# Dynamo graph ConnectPoints.dyf
# category: Revit

refPts = Input()
len = Length(refPts)
number = DoubleInput(2)
lt = LessThan(len, number)
empty = Empty()
take = TakeList(number, refPts)
curve_by_points = CurveByPoints(take)
rest = Rest(refPts)
ConnectPoints = Output(rest)
cons = List(curve_by_points, ConnectPoints)
if_ = Conditional(lt, empty, cons)
