# Dynamo graph Dynamic Relaxation Loop.dyf
# category: Miscellaneous

ps = Input()
number = DoubleInput(0.5)
exec = Input()
dynamic_relaxation_step = DynamicRelaxationStep(ps, number, exec)
watch_3d = dyn3DPreview(dynamic_relaxation_step)
number_2 = DoubleInput(1)
pause = Pause(number_2)
Dynamic_Relaxation_Loop = Output(ps, exec)
perform_all = Begin(expr1=watch_3d, expr2=pause, expr3=Dynamic_Relaxation_Loop)
