# Dynamo graph solarradopt.dyf
# category: Miscellaneous

amt = Input()
max = Input()
gt = GreaterThan(amt, max)
acc = Input()
fw = Input()
reset_file_watcher = FileWatcherReset(fw)
fI = Input()
p = Input()
set_instance_parameter = FamilyInstanceParameterSetter(fI, p, amt)
transaction = Transaction(set_instance_parameter)
number = DoubleInput(5000)
wait_for_change = FileWatcherWait(fw, number)
i = Input()
add = Addition(i, amt)
path = Input()
read_file = FileReader(path)
extract_solar_radiation_value = ComputeSolarRadiationValue(read_file)
solarradcomp = Output(acc, extract_solar_radiation_value, amt)
solarradopt = Output(fI, p, i, max, add, solarradcomp, path, fw)
begin = Begin(expr1=reset_file_watcher, expr2=transaction, expr3=wait_for_change, expr4=solarradopt)
if_ = Conditional(gt, acc, begin)
