# Dynamo graph inst param 2 masses driving each other.dyn

family_instance_by_selection = FamilyInstanceCreatorSelection()  # 1 picked in the model
family_instance_parameter = FamilyInstanceParameterSelector(family_instance_by_selection)
get_instance_parameter = FamilyInstanceParameterGetter(family_instance_by_selection, family_instance_parameter)
watch = Watch(get_instance_parameter)
family_instance_by_selection_2 = FamilyInstanceCreatorSelection()  # 1 picked in the model
set_instance_parameter = FamilyInstanceParameterSetter(family_instance_by_selection_2, family_instance_parameter, get_instance_parameter)
