# Dynamo graph family type inst set end.dyn

family_type_selector = FamilyTypeSelector(index=175)
string = StringInput("Cost")
number_slider = DoubleSliderInput(38.31417625, range=0..100)
set_type_parameter = FamilyTypeParameterSetter(family_type_selector, string, number_slider)
get_type_parameter = FamilyTypeParameterGetter(set_type_parameter, string)
family_instance_by_selection = FamilyInstanceCreatorSelection()  # 1 picked in the model
string_2 = StringInput("a")
set_instance_parameter = FamilyInstanceParameterSetter(family_instance_by_selection, string_2, number_slider)
get_instance_parameter = FamilyInstanceParameterGetter(set_instance_parameter, string_2)
watch = Watch(get_instance_parameter)
string_3 = StringInput("h")
number_slider_2 = DoubleSliderInput(300, range=0..300)
set_instance_parameter_2 = FamilyInstanceParameterSetter(family_instance_by_selection, string_3, number_slider_2)
