# Dynamo graph family type set.dyn

family_type_selector = FamilyTypeSelector(index=5)
string = StringInput("Cost")
number_slider = DoubleSliderInput(100, range=0..100)
set_type_parameter = FamilyTypeParameterSetter(family_type_selector, string, number_slider)
get_type_parameter = FamilyTypeParameterGetter(set_type_parameter, string)
watch = Watch(get_type_parameter)
