# Dynamo graph read python from file.dyn

filename = StringFilename("C:\xfer\Github\3\4\dynamo_VasBeta1_2013_GHforW\DynamoRevit\bin\Debug\samples\Python\dynamo python.py")
read_file = FileReader(filename)
number_slider = DoubleSliderInput(9.333333333, range=-10..10)
python_script_from_string = PythonString(read_file, number_slider)
watch = Watch(python_script_from_string)
watch_2 = Watch(read_file)
