# Dynamo graph ArduMote iPad udp listener family instance.dyn

family_instance_by_selection = FamilyInstanceCreatorSelection()  # 1 picked in the model
family_parameter_selector = FamilyInstanceParameterSelector(family_instance_by_selection)
number = DoubleInput(1)
# note: Milliseconds between Samples
number_2 = DoubleInput(10)
execution_interval = ExecuteInterval(number_2)
# note: UDP Port for ArduMote on iPad
number_3 = DoubleInput(7777)
udp_listener = UDPListener(execution_interval, number_3)
string = StringInput("test%3a123")
if_ = Conditional(udp_listener, udp_listener, string)
watch = Watch(if_)
# note: ArduMote inputs being sent to Dynamo
string_2 = StringInput("%3a")
split_string = SplitString(watch, string_2)
get = GetFromList(number, split_string)
string_number = String2Num(get)
watch_2 = Watch(string_number)
set_instance_parameter = FamilyInstanceParameterSetter(family_instance_by_selection, family_parameter_selector, watch_2)
count = Length(split_string)
watch_3 = Watch(count)
watch_4 = Watch(udp_listener)
