# Dynamo graph Arc and Line.dyn

point_by_selection = PointBySelection()  # 1 picked in the model
xyz_from_ref_point = XYZFromReferencePoint(point_by_selection)
point_by_selection_2 = PointBySelection()  # 1 picked in the model
xyz_from_ref_point_2 = XYZFromReferencePoint(point_by_selection_2)
point_by_selection_3 = PointBySelection()  # 1 picked in the model
xyz_from_ref_point_3 = XYZFromReferencePoint(point_by_selection_3)
arc_by_center_point = ArcStartMiddleEnd(xyz_from_ref_point, xyz_from_ref_point_2, xyz_from_ref_point_3)
xyz_basisz = XYZBasisZ()
xyz_zero = XYZZero()
plane = Plane(xyz_basisz, xyz_zero)
sketch_plane = SketchPlane(plane)
model_curve = ModelCurve(arc_by_center_point, sketch_plane)
boolean = BoolSelector(true)
line = LineBound(xyz_from_ref_point, xyz_from_ref_point_3, boolean)
list = NewList(index0=arc_by_center_point, index1=line)
watch_3d = dyn3DPreview(list)
model_curve_2 = ModelCurve(line, sketch_plane)
