# Dynamo graph circle.dyn

number_slider = DoubleSliderInput(0, range=0..100)
number = DoubleInput(0)
XYZ = XYZ(number_slider, number, number)
number_slider_2 = DoubleSliderInput(40.90909091, range=0..100)
circle = Circle(XYZ, number_slider_2)
xyz_basisz = XYZBasisZ()
plane = Plane(xyz_basisz, XYZ)
sketch_plane = SketchPlane(plane)
model_curve = ModelCurve(circle, sketch_plane)
curve_by_selection = CurvesBySelection()  # 1 picked in the model
curve_from_curve_element = CurveFromModelCurve(curve_by_selection)
list = NewList(index0=circle, index1=curve_from_curve_element)
watch_3d = dyn3DPreview(list)
