# Dynamo graph 4. form from curve selection.dyn

boolean = BoolSelector(true)
curves_by_selection = CurvesBySelection()  # 1 picked in the model
curves_by_selection_2 = CurvesBySelection()  # 1 picked in the model
list = NewList(index0=curves_by_selection, index1=curves_by_selection_2)
loft_form = LoftForm(boolean, list)
