# Dynamo graph 6. create sine wave from selected points.dyn

point_by_selection = PointBySelection()
point_by_selection_2 = PointBySelection()
list = NewList(index0=point_by_selection, index1=point_by_selection_2)
python_script = Python(list)
# ---------- python_script.python (28 lines) ----------
import math

doc = __revit__.ActiveUIDocument.Document
app = __revit__.Application

beginPoint = IN[0]
endPoint = IN[1]
lineRefPointArray = ReferencePointArray()
lineRefPointArray.Append(beginPoint)
lineRefPointArray.Append(endPoint)
crv = doc.FamilyCreate.NewCurveByPoints(lineRefPointArray)
crvRef = crv.GeometryCurve
refptarr = ReferencePointArray()

#use for loop to create a series of points
steps = 20
for i in range(0,steps+1):
    pt = crvRef.Evaluate(float(i)/steps,1) # returns and XYZ
    x = pt.X
    y = pt.Y
    #x = i*2
    #y = i*2
    #z is controlled using sine
    z = pt.Z + math.sin(i)*20
    myXYZ = XYZ(x,y,z)
    refPt = doc.FamilyCreate.NewReferencePoint(myXYZ)
    refptarr.Append(refPt)
crv2 = doc.FamilyCreate.NewCurveByPoints(refptarr)
# ----------------------------------------
