# Dynamo graph 6.1 create sine wave from selected curve.dyn

curve_by_selection = CurvesBySelection()  # 1 picked in the model
python_script = Python(curve_by_selection)
# ---------- python_script.python (23 lines) ----------
import math

doc = __revit__.ActiveUIDocument.Document
app = __revit__.Application

crv = IN
crvRef = crv.GeometryCurve
refptarr = ReferencePointArray()

#use for loop to create a series of points
steps = 20
for i in range(0,steps+1):
    pt = crvRef.Evaluate(float(i)/steps,1) # returns and XYZ
    x = pt.X
    y = pt.Y
    #x = i*2
    #y = i*2
    #z is controlled using sine
    z = pt.Z + math.sin(i)*20
    myXYZ = XYZ(x,y,z)
    refPt = doc.FamilyCreate.NewReferencePoint(myXYZ)
    refptarr.Append(refPt)
crv2 = doc.FamilyCreate.NewCurveByPoints(refptarr)
# ----------------------------------------
