# Dynamo graph tower 2.dyn

number_slider = DoubleSliderInput(310, range=0..900)
# note: top
level = Level(number_slider)
number_slider_2 = DoubleSliderInput(60, range=0..100)
level_2 = Level(number_slider_2)
# note: Base
number = DoubleInput(0)
# note: need level picker for level 1
level_3 = Level(number)
# note: Mid
# note: Lower Floor To Floor
number_slider_3 = DoubleSliderInput(5.333333333, range=0..10)
boolean = BoolSelector(false)
Array = Output(number, number_slider_2, number_slider_3, boolean)
level_4 = Level(Array)
watch = Watch(level_4)
number_slider_4 = DoubleSliderInput(11.5, range=0..15)
build_sequence = BuildSeq(number_slider_2, number_slider, number_slider_4)
level_5 = Level(build_sequence)
