# Dynamo graph tower.dyn

number_slider = DoubleSliderInput(760, range=0..900)
# note: top
level = Level(number_slider)
number_slider_2 = DoubleSliderInput(60, range=0..100)
level_2 = Level(number_slider_2)
# note: Base
number = DoubleInput(0)
# note: need level picker for level 1
level_3 = Level(number)
# note: Mid
# note: Lower Floor To Floor
number_slider_3 = DoubleSliderInput(26.66666667, range=0..100)
Array = Output(number, number_slider_2, number_slider_3)
watch = Watch(Array)
