# Dynamo graph Dynamic Relaxation Loop.dyf
# category: Miscellaneous

ps = Input()
number = DoubleInput(0.005)
dynamic_relaxation_step = DynamicRelaxationStep(ps, number)
number_2 = DoubleInput(1)
pause = Pause(number_2)
Dynamic_Relaxation_Loop = Output(ps)
perform_all = Begin(expr1=dynamic_relaxation_step, expr2=pause, expr3=Dynamic_Relaxation_Loop)
