# Dynamo graph Solar Radiation Optimizer.dyf
# Copyright Autodesk, Inc. 2012. All rights reserved.
# Licensed under the Apache License, Version 2.0 (the "License");
# you may not use this file except in compliance with the License.
# You may obtain a copy of the License at
# http://www.apache.org/licenses/LICENSE-2.0
# Unless required by applicable law or agreed to in writing, software
# distributed under the License is distributed on an "AS IS" BASIS,
# WITHOUT WARRANTIES OR CONDITIONS OF ANY KIND, either express or implied.
# See the License for the specific language governing permissions and
# limitations under the License.
# category: Revit

famInst = Input()
parameter = Input()
increment = Input()
max = Input()
number = DoubleInput(0)
list = NewList(index0=number, index1=number)
path = Input()
watch_file = FileWatcher(path)
solarradopt = Output(famInst, parameter, increment, max, number, list, path, watch_file)
solarradupdate = Output(famInst, parameter, solarradopt)
