# Dynamo graph dice.dyf "Dice"
# category: Lists

lst = Input()
is_empty = IsEmpty(lst)
empty = Empty()
amt = Input()
take = TakeList(amt, lst)
drop = DropList(amt, lst)
Dice = Output(drop, amt)
cons = List(take, Dice)
if_ = Conditional(is_empty, empty, cons)
