# Dynamo graph solarradcomp.dyf
# category: Miscellaneous

acc = Input()
first = First(acc)
data = Input()
gt = GreaterThan(first, data)
newAmt = Input()
list = NewList(index0=data, index1=newAmt)
if_ = Conditional(gt, acc, list)
