# Dynamo graph dynRelaxationTest4.5.dyn

watch_3d = dyn3DPreview()
number = DoubleInput(0)
number_2 = DoubleInput(10)
number_3 = DoubleInput(10)
number_4 = DoubleInput(20)
number_5 = DoubleInput(10)
number_slider = DoubleSliderInput(9.909090909, range=0..10)
number_slider_2 = DoubleSliderInput(1, range=1..10)
create_particle_system = DynamicRelaxation(number, number, number_2, number_3, number_4, number_5, number_slider, number_slider_2)
number_6 = DoubleInput(0.6)
number_7 = DoubleInput(0.1)
execution_interval = ExecuteInterval(number_7)
dynamic_relaxation_step = DynamicRelaxationStep(create_particle_system, number_6, execution_interval)
reference_point = ReferencePointByXYZ(dynamic_relaxation_step)
ConnectPoints = Output(reference_point)
