# Dynamo graph dynRelaxationTest5.dyn

number = DoubleInput(0.1)
watch_3d = dyn3DPreview()
number_2 = DoubleInput(1)
execution_interval = ExecuteInterval(number_2)
number_3 = DoubleInput(0)
number_4 = DoubleInput(1)
number_5 = DoubleInput(10)
number_6 = DoubleInput(20)
number_7 = DoubleInput(1)
number_slider = DoubleSliderInput(10, range=0..10)
number_slider_2 = DoubleSliderInput(6.363636364, range=0..10)
create_particle_system = DynamicRelaxation(number_3, number_3, number_4, number_5, number_6, number_7, number_slider, number_slider_2)
Dynamic_Relaxation_Loop = Output(create_particle_system)
