# Dynamo graph dynRelaxationTest7.dyn

number = DoubleInput(0.1)
dynamic_relaxation_step = DynamicRelaxationStep()
watch_3d = dyn3DPreview(dynamic_relaxation_step)
number_2 = DoubleInput(0)
# note: Dampening
number_slider = DoubleSliderInput(1, range=0..5)
# note: Spring Constant
number_slider_2 = DoubleSliderInput(10, range=0..10)
# note: Rest Length
number_slider_3 = DoubleSliderInput(20.72727273, range=0..40)
# note: Mass of Node
number_slider_4 = DoubleSliderInput(10, range=0..10)
# note: Number of Nodes in X
number_slider_5 = DoubleSliderInput(20, range=0..20)
# note: Number of Nodes in Y
number_slider_6 = DoubleSliderInput(1, range=1..10)
create_particle_system = DynamicRelaxation(number_2, number_2, number_slider, number_slider_2, number_slider_3, number_slider_4, number_slider_5, number_slider_6)
number_3 = DoubleInput(0.1)
execution_interval = ExecuteInterval(number_3)
Dynamic_Relaxation_Loop = Output(create_particle_system, execution_interval)
