# Dynamo graph point on face and curve.dyn

face_by_selection = FormElementBySelection()
number = DoubleInput(0.5)
reference_point_on_face = PointOnFace(face_by_selection, number, number)
debug_breakpoint = Breakpoint(reference_point_on_face)
number_2 = DoubleInput(0)
number_3 = DoubleInput(0)
number_4 = DoubleInput(0)
XYZ = XYZ(number_2, number_3, number_4)
reference_point = ReferencePointByXYZ(XYZ)
number_5 = DoubleInput(120)
XYZ_2 = XYZ(number_2, number_3, number_5)
reference_point_2 = ReferencePointByXYZ(XYZ_2)
list = NewList(index0=reference_point, index1=reference_point_2)
curve_by_points = CurveByPoints(list)
reference_point_on_edge = PointOnEdge(curve_by_points, number)
