# Dynamo graph connect two point arrays without python.dyn

curve_by_points = CurveByPoints()
list = NewList()
curve_by_selection = CurvesBySelection()  # 1 picked in the model
number_slider = DoubleSliderInput(4.266666667, range=0..20)
xyz_array_along_curve = XYZArrayAlongCurve(curve_by_selection, number_slider)
reference_point = ReferencePointByXYZ(xyz_array_along_curve)
curve_by_selection_2 = CurvesBySelection()  # 1 picked in the model
xyz_array_along_curve_2 = XYZArrayAlongCurve(curve_by_selection_2, number_slider)
reference_point_2 = ReferencePointByXYZ(xyz_array_along_curve_2)
combine = Combine(list, reference_point, reference_point_2)
map = Map(curve_by_points, combine)
