# Dynamo graph inst param 2 masses.dyn

family_instance_by_selection = FamilyInstanceCreatorSelection()  # 1 picked in the model
family_instance_parameter = FamilyInstanceParameterSelector(family_instance_by_selection)
number_slider = DoubleSliderInput(40, range=0..100)
set_instance_parameter = FamilyInstanceParameterSetter(family_instance_by_selection, family_instance_parameter, number_slider)
get_instance_parameter = FamilyInstanceParameterGetter(set_instance_parameter, family_instance_parameter)
watch = Watch(get_instance_parameter)
family_instance_by_selection_2 = FamilyInstanceCreatorSelection()  # 1 picked in the model
set_instance_parameter_2 = FamilyInstanceParameterSetter(family_instance_by_selection_2, family_instance_parameter, number_slider)
