# Dynamo graph inst param end.dyn

family_instance_by_selection = FamilyInstanceCreatorSelection()  # 1 picked in the model
family_instance_parameter = FamilyInstanceParameterSelector(family_instance_by_selection)
number_slider = DoubleSliderInput(0.3, range=0..1)
set_instance_parameter = FamilyInstanceParameterSetter(family_instance_by_selection, family_instance_parameter, number_slider)
get_instance_parameter = FamilyInstanceParameterGetter(set_instance_parameter, family_instance_parameter)
watch = Watch(get_instance_parameter)
