# Dynamo graph inst param.dyn

set_instance_parameter = FamilyInstanceParameterSetter()
family_instance_by_selection = FamilyInstanceCreatorSelection()  # 1 picked in the model
family_instance_parameter = FamilyInstanceParameterSelector(family_instance_by_selection)
get_instance_parameter = FamilyInstanceParameterGetter(family_instance_by_selection, family_instance_parameter)
watch = Watch(get_instance_parameter)
