# Dynamo graph DynamicMobius.dyn
# Copyright Nathan Miller 2012.The Proving Ground http://nmillerarch.blogspot.com
# Licensed under the Apache License, Version 2.0 (the "License");
# you may not use this file except in compliance with the License.
# You may obtain a copy of the License at
# http://www.apache.org/licenses/LICENSE-2.0
# Unless required by applicable law or agreed to in writing, software
# distributed under the License is distributed on an "AS IS" BASIS,
# WITHOUT WARRANTIES OR CONDITIONS OF ANY KIND, either express or implied.
# See the License for the specific language governing permissions and
# limitations under the License.

filename = StringFilename("C:\Users\Nathan\Dropbox\AU2012 Python_Dynamo_Vasari\## Presentation\Examples\03 Dynamo + Python\01-RPS-Mobius.py")
read_file = FileReader(filename)
number_slider = DoubleSliderInput(0, range=0..3)
python_script_from_string = PythonString(read_file, number_slider)
watch = Watch(read_file)
