# Dynamo graph family type inst set end 2.dyn

family_instance_by_selection = FamilyInstanceCreatorSelection()  # 1 picked in the model
string = StringInput("top_rad")
number_slider = DoubleSliderInput(32.62411348, range=0..100)
set_instance_parameter = FamilyInstanceParameterSetter(family_instance_by_selection, string, number_slider)
get_instance_parameter = FamilyInstanceParameterGetter(set_instance_parameter, string)
watch = Watch(get_instance_parameter)
string_2 = StringInput("h")
number_slider_2 = DoubleSliderInput(300, range=0..300)
