# Dynamo graph family type inst set.dyn

family_type_selector = FamilyTypeSelector(index=175)
string = StringInput("Cost")
number_slider = DoubleSliderInput(20, range=0..100)
set_type_parameter = FamilyTypeParameterSetter(family_type_selector, string, number_slider)
get_type_parameter = FamilyTypeParameterGetter(set_type_parameter, string)
watch = Watch(get_type_parameter)
family_instance_by_selection = FamilyInstanceCreatorSelection()  # 1 picked in the model
string_2 = StringInput("a")
set_instance_parameter = FamilyInstanceParameterSetter(family_instance_by_selection, string_2, number_slider)
