# Dynamo graph family type.dyn

set_type_parameter = FamilyTypeParameterSetter()
family_type_selector = FamilyTypeSelector(index=3)
string = StringInput("Cost")
get_type_parameter = FamilyTypeParameterGetter(family_type_selector, string)
watch = Watch(get_type_parameter)
