# Dynamo graph tower 1.dyn

number_slider = DoubleSliderInput(760, range=0..900)
# note: top
level = Level(number_slider)
number_slider_2 = DoubleSliderInput(60, range=0..100)
level_2 = Level(number_slider_2)
# note: Base
# note: a
number = DoubleInput(0)
level_3 = Level(number)
# note: Mid
# note: Lower Floor To Floor
number_slider_3 = DoubleSliderInput(20, range=0..20)
build_sequence = BuildSeq()
watch = Watch(build_sequence)
