# Dynamo graph 1.1 create point - end.dyn
# Copyright © Autodesk, Inc. 2012. All rights reserved.
# Licensed under the Apache License, Version 2.0 (the "License");
# you may not use this file except in compliance with the License.
# You may obtain a copy of the License at
# http://www.apache.org/licenses/LICENSE-2.0
# Unless required by applicable law or agreed to in writing, software
# distributed under the License is distributed on an "AS IS" BASIS,
# WITHOUT WARRANTIES OR CONDITIONS OF ANY KIND, either express or implied.
# See the License for the specific language governing permissions and
# limitations under the License.

number = DoubleInput(0)
number_2 = DoubleInput(0)
number_slider = DoubleSliderInput(0, range=0..100)
XYZ = XYZ(number, number_2, number_slider)
reference_point = ReferencePointByXYZ(XYZ)
