# Dynamo graph truss.dyn

watch = Watch()
curve_by_points = CurveByPoints()
number = DoubleInput(300)
reference_point_by_normal = PointNormalDistance(arg2=number)
face_by_selection = FormElementBySelection()  # 1 picked in the model
reference_point_on_face = PointOnFace(face_by_selection)
# note: Select a face.
number_2 = DoubleInput(0)
number_3 = DoubleInput(1000)
# note: Make a grid of UVs
number_4 = DoubleInput(100)
build_sequence = BuildSeq(number_2, number_3, number_4)
cartesian_product = CartProd(reference_point_on_face, build_sequence, build_sequence)
evaluate_normal = NormalEvaluate(arg1=face_by_selection)
# note: Create the offset points.
map = Map(evaluate_normal, cartesian_product)
combine = Combine(reference_point_by_normal, cartesian_product, map)
# note: Draw points on the selected face
count = Length(build_sequence)
# note: Draw between normal pts.
Dice = Output(combine, count)
map_2 = Map(curve_by_points, Dice)
# note: Draw between normal points in the other direction
curve_by_points_2 = CurveByPoints()
list = NewList()
combine_2 = Combine(list, Dice)
map_3 = Map(curve_by_points_2, combine_2)
curve_by_points_3 = CurveByPoints()
list_2 = NewList()
combine_3 = Combine(list_2, combine, cartesian_product)
# note: Connect the face points and the offset points.
map_4 = Map(curve_by_points_3, combine_3)
curve_by_points_4 = CurveByPoints()
Dice_2 = Output(cartesian_product, count)  # "Dice"
map_5 = Map(curve_by_points_4, Dice_2)
curve_by_points_5 = CurveByPoints()
map_6 = Map(curve_by_points_5)
laceForward = Output(Dice)
