# Dynamo graph arduino.dyn

number = DoubleInput(10)
execution_interval = ExecuteInterval(number)
arduino = Arduino(COM9, execution_interval)
number_slider = DoubleSliderInput(34.24793388, range=0..100)
read_arduino = ArduinoRead(arduino, number_slider)
watch = Watch(read_arduino)
first = First(read_arduino)
watch_2 = Watch(first)
