# Dynamo graph Arc.dyn

point_by_selection = PointBySelection()  # 1 picked in the model
xyz_from_ref_point = XYZFromReferencePoint(point_by_selection)
point_by_selection_2 = PointBySelection()  # 1 picked in the model
xyz_from_ref_point_2 = XYZFromReferencePoint(point_by_selection_2)
point_by_selection_3 = PointBySelection()  # 1 picked in the model
xyz_from_ref_point_3 = XYZFromReferencePoint(point_by_selection_3)
arc = Arc(xyz_from_ref_point, xyz_from_ref_point_2, xyz_from_ref_point_3)
xyz_basisz = XYZBasisZ()
xyz_zero = XYZZero()
plane = Plane(xyz_basisz, xyz_zero)
sketch_plane = SketchPlane(plane)
model_curve = ModelCurve(arc, sketch_plane)
watch = Watch(model_curve)
list = NewList(item_s=arc)
watch_3d = dyn3DPreview(list)
