# Dynamo graph helix.dyn

number_slider = DoubleSliderInput(100, range=0..100)
python_script = Python(number_slider)
# ---------- python_script.python (35 lines) ----------
# adapted from Nathan Miller's Proving Ground Blog
# http://wiki.theprovingground.org/revit-api-py-curves

import clr
import math
 
doc = __revit__.ActiveUIDocument.Document
app = __revit__.Application

#deal with older elements
if DynStoredElements.Count>0:
     count = 0
     for eID in DynStoredElements:
          e = doc.get_Element(DynStoredElements[count])
          doc.Delete(e)

scale = IN

refptarr = ReferencePointArray()
 
#use for loop to create a series of points
for i in range(0,20):
    x = math.sin(i)*scale
    y = math.cos(i)*scale
    z = i*scale/2
 
    myXYZ = XYZ(x,y,z)
    refPt = doc.FamilyCreate.NewReferencePoint(myXYZ)
    refptarr.Append(refPt)
    #DynStoredElements.Add(refPt.Id)
 
#create curve
crv = doc.FamilyCreate.NewCurveByPoints(refptarr)
DynStoredElements.Add(crv.Id)
OUT = crv;
# ----------------------------------------
curve_from_curve_element = CurveFromModelCurve(python_script)
watch = Watch(curve_from_curve_element)
watch_3d = dyn3DPreview(curve_from_curve_element)
