# Dynamo graph LeapTests.dyn

number = DoubleInput(10)
execution_interval = ExecuteInterval(number)
leap = LeapController(execution_interval)
leap_frame = LeapFrame(leap)
leap_hand_1 = LeapHand1(leap_frame)
leap_finger_2 = LeapFinger2(leap_hand_1)
leap_position = LeapPosition(leap_finger_2)
reference_point = ReferencePointByXYZ(leap_position)
leap_hand_2 = LeapHand2(leap_frame)
leap_finger_2_2 = LeapFinger2(leap_hand_2)
leap_position_2 = LeapPosition(leap_finger_2_2)
reference_point_2 = ReferencePointByXYZ(leap_position_2)
