# Dynamo graph 2. ref grid sliders.dyn
# Copyright © Autodesk, Inc. 2012. All rights reserved.
# Licensed under the Apache License, Version 2.0 (the "License");
# you may not use this file except in compliance with the License.
# You may obtain a copy of the License at
# http://www.apache.org/licenses/LICENSE-2.0
# Unless required by applicable law or agreed to in writing, software
# distributed under the License is distributed on an "AS IS" BASIS,
# WITHOUT WARRANTIES OR CONDITIONS OF ANY KIND, either express or implied.
# See the License for the specific language governing permissions and
# limitations under the License.

number_slider = DoubleSliderInput(18, range=0..20)
number = DoubleInput(1)
number_2 = DoubleInput(0)
number_slider_2 = DoubleSliderInput(30, range=0..50)
number_slider_3 = DoubleSliderInput(19, range=0..50)
number_3 = DoubleInput(0)
xyz_grid = ReferencePtGrid(number_slider, number_slider, number, number_2, number_2, number_2, number_slider_2, number_slider_3, number_3)
reference_point = ReferencePointByXYZ(xyz_grid)
