# Dynamo graph 2.1 ref grid sliders - end.dyn

reference_point = ReferencePointByXYZ()
number_slider = DoubleSliderInput(18, range=0..20)
number = DoubleInput(1)
number_2 = DoubleInput(0)
number_slider_2 = DoubleSliderInput(30, range=0..50)
number_slider_3 = DoubleSliderInput(19, range=0..50)
number_3 = DoubleInput(0)
xyz_grid = ReferencePtGrid(number_slider, number_slider, number, number_2, number_2, number_2, number_slider_2, number_slider_3, number_3)
family_type_selector = FamilyTypeSelector()
family_instance_creator = FamilyInstanceCreatorXYZ(xyz_grid, family_type_selector)
