# Dynamo graph 3. 1form from curve selection and point on face.dyn

boolean = BoolSelector(true)
curves_by_selection = CurvesBySelection()
curve_reference = CurveRef(curves_by_selection)
curves_by_selection_2 = CurvesBySelection()
curve_reference_2 = CurveRef(curves_by_selection_2)
list = NewList(index0=curve_reference, index1=curve_reference_2)
loft_form = LoftForm(boolean, list)
face_by_selection = FormElementBySelection()
number_slider = DoubleSliderInput(36.66666667)
number = DoubleInput(100)
division = Division(number_slider, number)
number_slider_2 = DoubleSliderInput(56.66666667)
division_2 = Division(number_slider_2, number)
reference_point_on_face = PointOnFace(face_by_selection, division, division_2)
