# Dynamo graph 3. form from curve selection works now with lists.dyn

boolean = BoolSelector(true)
curves_by_selection = CurvesBySelection()  # 1 picked in the model
curve_reference = CurveRef(curves_by_selection)
list = NewList(index0=curve_reference)
curves_by_selection_2 = CurvesBySelection()  # 1 picked in the model
curve_reference_2 = CurveRef(curves_by_selection_2)
list_2 = NewList(index0=curve_reference_2)
curve_by_selection = CurvesBySelection()  # 1 picked in the model
curveelement_reference = CurveRef(curve_by_selection)
list_3 = NewList(index0=curveelement_reference)
list_4 = NewList(index0=list, index1=list_2, index2=list_3)
loft_form = LoftForm(boolean, list_4)
