# Dynamo graph 3.1 divide selected curve - end.dyn

number = DoubleInput(21)
curve_by_selection = CurvesBySelection()  # 1 picked in the model
number_slider = DoubleSliderInput(33.33333333, range=0..100)
xyz_array_along_curve = XYZArrayAlongCurve(curve_by_selection, number_slider)
reference_point = ReferencePointByXYZ(xyz_array_along_curve)
