# Dynamo graph 4.1 form from curve selection - list.dyn
# Copyright © Autodesk, Inc. 2012. All rights reserved.
# Licensed under the Apache License, Version 2.0 (the "License");
# you may not use this file except in compliance with the License.
# You may obtain a copy of the License at
# http://www.apache.org/licenses/LICENSE-2.0
# Unless required by applicable law or agreed to in writing, software
# distributed under the License is distributed on an "AS IS" BASIS,
# WITHOUT WARRANTIES OR CONDITIONS OF ANY KIND, either express or implied.
# See the License for the specific language governing permissions and
# limitations under the License.

boolean = BoolSelector(true)
curves_by_selection = CurvesBySelection()
curve_reference = CurveRef(curves_by_selection)
list = NewList(index0=curve_reference)
curves_by_selection_2 = CurvesBySelection()
curve_reference_2 = CurveRef(curves_by_selection_2)
list_2 = NewList(index0=curve_reference_2)
list_3 = NewList(index0=list, index1=list_2)
loft_form = LoftForm(boolean, list_3)
