# Dynamo graph 5. graph function.dyn

number = DoubleInput(-1)
π = Pi()
multiplication = Multiplication(number, π)
number_2 = DoubleInput(32)
division = Division(π, number_2)
sine = Sin()
GraphFunction = Output(multiplication, π, division, sine)
reference_point = ReferencePointByXYZ(GraphFunction)
