# Dynamo graph 5.2 scalable graph function.dyn
# Copyright © Autodesk, Inc. 2012. All rights reserved.
# Licensed under the Apache License, Version 2.0 (the "License");
# you may not use this file except in compliance with the License.
# You may obtain a copy of the License at
# http://www.apache.org/licenses/LICENSE-2.0
# Unless required by applicable law or agreed to in writing, software
# distributed under the License is distributed on an "AS IS" BASIS,
# WITHOUT WARRANTIES OR CONDITIONS OF ANY KIND, either express or implied.
# See the License for the specific language governing permissions and
# limitations under the License.

number_slider = DoubleSliderInput(32.66666667, range=0..50)
number = DoubleInput(-1)
π = Pi()
multiplication = Multiplication(number, π)
multiplication_2 = Multiplication(number_slider, multiplication)
multiplication_3 = Multiplication(π, number_slider)
number_2 = DoubleInput(32)
division = Division(π, number_2)
multiplication_4 = Multiplication(number_slider, division)
number_slider_2 = DoubleSliderInput(1, range=0..10)
multiplication_5 = Multiplication(number_slider, number_slider_2)
number_3 = DoubleInput(1)
division_2 = Division(number_3, number_slider)
sine = Sin()
C_f_dx = Output(multiplication_5, division_2, sine)  # "C*f(dx)"
GraphFunction = Output(multiplication_2, multiplication_3, multiplication_4, C_f_dx)
reference_point = ReferencePointByXYZ(GraphFunction)
ConnectPoints = Output(reference_point)
