# Dynamo graph 8. solar radiation optimizer.dyn

family_instance_selection = FamilyInstanceCreatorSelection()  # 1 picked in the model
string = StringInput("increment")
number = DoubleInput(1)
number_2 = DoubleInput(36)
filename = StringFilename("C:\Users\t_ellist\Desktop\solar.csv")
Solar_Radiation_Optimizer = Output(family_instance_selection, string, number, number_2, filename)
