# Dynamo graph tower 4.dyn

number_slider = DoubleSliderInput(600, range=0..600)
# note: top
level = Level(number_slider)
number_slider_2 = DoubleSliderInput(100, range=0..100)
level_2 = Level(number_slider_2)
# note: Base
number = DoubleInput(0)
# note: need level picker for level 1
level_3 = Level(number)
# note: Mid
# note: Lower Floor To Floor
number_slider_3 = DoubleSliderInput(10, range=0..10)
boolean = BoolSelector(true)
Array = Output(number, number_slider_2, number_slider_3, boolean)
watch = Watch(Array)
level_4 = Level(Array)
build_sequence = BuildSeq()
number_slider_4 = DoubleSliderInput(20, range=0..20)
Array_2 = Output(number_slider_2, number_slider, number_slider_4, boolean)  # "Array"
level_5 = Level(Array_2)
