# Dynamo graph tower 10.dyn

# note: Base
number = DoubleInput(0)
number_slider = DoubleSliderInput(100, range=0..100)
# note: Mid
# note: Lower Floor To Floor
number_slider_2 = DoubleSliderInput(20, range=0..20)
boolean = BoolSelector(true)
Array = Output(number, number_slider, number_slider_2, boolean)
watch = Watch(Array)
level = Level(Array)
number_slider_3 = DoubleSliderInput(600, range=0..600)
number_slider_4 = DoubleSliderInput(10, range=0..10)
Array_2 = Output(number_slider, number_slider_3, number_slider_4, boolean)  # "Array"
level_2 = Level(Array_2)
number_2 = DoubleInput(0)
XYZ = XYZ(number_2, number_2, number_2)
family_type_selector = FamilyTypeSelector(index=5)
# note: need level picker for level 1
level_3 = Level(number)
family_instance_by_level_creator = FamilyInstanceCreatorLevel(XYZ, family_type_selector, level_3)
curves_from_family = CurvesFromFamilyInstance(family_instance_by_level_creator)
watch_2 = Watch(curves_from_family)
boolean_2 = BoolSelector(true)
curveelement_reference = CurveRef(curves_from_family)
XYZ_2 = XYZ(number_2, number_2, number_slider)
level_4 = Level(number_slider)
family_instance_by_level_creator_2 = FamilyInstanceCreatorLevel(XYZ_2, family_type_selector, level_4)
curves_from_family_2 = CurvesFromFamilyInstance(family_instance_by_level_creator_2)
curveelement_reference_2 = CurveRef(curves_from_family_2)
XYZ_3 = XYZ(number_2, number_2, number_slider_3)
# note: top
level_5 = Level(number_slider_3)
family_instance_by_level_creator_3 = FamilyInstanceCreatorLevel(XYZ_3, family_type_selector, level_5)
curves_from_family_3 = CurvesFromFamilyInstance(family_instance_by_level_creator_3)
curveelement_reference_3 = CurveRef(curves_from_family_3)
list = NewList(item_s=curveelement_reference, index1=curveelement_reference_2, index2=curveelement_reference_3)
loft_form = LoftForm(boolean_2, list)
watch_3 = Watch(list)
CurveLoop = Output(number_slider, curves_from_family_2)
CurveLoop_2 = Output(number_2, curves_from_family)  # "CurveLoop"
CurveLoop_3 = Output(number_slider_3, curves_from_family_3)  # "CurveLoop"
watch_4 = Watch()
