# Dynamo graph tower 12.dyn

# note: Base
number = DoubleInput(0)
number_slider = DoubleSliderInput(100, range=0..100)
# note: Mid
# note: Lower Floor To Floor
number_slider_2 = DoubleSliderInput(20, range=0..20)
boolean = BoolSelector(true)
Array = Output(number, number_slider, number_slider_2, boolean)
watch = Watch(Array)
level = Level(Array)
number_slider_3 = DoubleSliderInput(600, range=0..600)
number_slider_4 = DoubleSliderInput(10, range=0..10)
Array_2 = Output(number_slider, number_slider_3, number_slider_4, boolean)  # "Array"
level_2 = Level(Array_2)
number_2 = DoubleInput(0)
XYZ = XYZ(number_2, number_2, number_slider_3)
family_type_selector = FamilyTypeSelector(index=5)
# note: top
level_3 = Level(number_slider_3)
family_instance_by_level_creator = FamilyInstanceCreatorLevel(XYZ, family_type_selector, level_3)
watch_2 = Watch()
boolean_2 = BoolSelector(true)
boolean_3 = BoolSelector(false)
loft_form = LoftForm(boolean_2, arg2=boolean_3)
XYZ_2 = XYZ(number_2, number_2, number_slider)
level_4 = Level(number_slider)
family_instance_by_level_creator_2 = FamilyInstanceCreatorLevel(XYZ_2, family_type_selector, level_4)
list = NewList()
watch_3 = Watch(list)
XYZ_3 = XYZ(number_2, number_2, number)
# note: need level picker for level 1
level_5 = Level(number)
family_instance_by_level_creator_3 = FamilyInstanceCreatorLevel(XYZ_3, family_type_selector, level_5)
watch_4 = Watch()
Family_Curve_Loop = Output(number_slider_3)
Family_Curve_Loop_2 = Output(number_slider)  # "Family Curve Loop"
Family_Curve_Loop_3 = Output(number)  # "Family Curve Loop"
