# Dynamo graph tower 7.dyn

number_slider = DoubleSliderInput(600, range=0..600)
# note: top
level = Level(number_slider)
number_slider_2 = DoubleSliderInput(100, range=0..100)
level_2 = Level(number_slider_2)
# note: Base
number = DoubleInput(0)
# note: Mid
# note: Lower Floor To Floor
number_slider_3 = DoubleSliderInput(20, range=0..20)
boolean = BoolSelector(true)
Array = Output(number, number_slider_2, number_slider_3, boolean)
watch = Watch(Array)
level_3 = Level(Array)
build_sequence = BuildSeq()
number_slider_4 = DoubleSliderInput(10, range=0..10)
Array_2 = Output(number_slider_2, number_slider, number_slider_4, boolean)  # "Array"
level_4 = Level(Array_2)
number_2 = DoubleInput(0)
XYZ = XYZ(number_2, number_2, number_2)
family_type_selector = FamilyTypeSelector(index=5)
# note: need level picker for level 1
level_5 = Level(number)
family_instance_by_level_creator = FamilyInstanceCreatorLevel(XYZ, family_type_selector, level_5)
curves_from_family = CurvesFromFamilyInstance(family_instance_by_level_creator)
watch_2 = Watch(curves_from_family)
boolean_2 = BoolSelector(false)
curveelement_reference = CurveRef(curves_from_family)
list = NewList(item_s=curveelement_reference)
loft_form = LoftForm(boolean_2, list)
