# Dynamo graph tower 9.1 curves.dyn

number_slider = DoubleSliderInput(600, range=0..600)
# note: top
level = Level(number_slider)
# note: Base
number = DoubleInput(0)
number_slider_2 = DoubleSliderInput(100, range=0..100)
# note: Mid
# note: Lower Floor To Floor
number_slider_3 = DoubleSliderInput(20, range=0..20)
boolean = BoolSelector(true)
Array = Output(number, number_slider_2, number_slider_3, boolean)
watch = Watch(Array)
level_2 = Level(Array)
number_slider_4 = DoubleSliderInput(10, range=0..10)
Array_2 = Output(number_slider_2, number_slider, number_slider_4, boolean)  # "Array"
level_3 = Level(Array_2)
number_2 = DoubleInput(0)
XYZ = XYZ(number_2, number_2, number_2)
family_type_selector = FamilyTypeSelector(index=4)
# note: need level picker for level 1
level_4 = Level(number)
family_instance_by_level_creator = FamilyInstanceCreatorLevel(XYZ, family_type_selector, level_4)
curves_from_family = CurvesFromFamilyInstance(family_instance_by_level_creator)
watch_2 = Watch(curves_from_family)
boolean_2 = BoolSelector(true)
number_3 = DoubleInput(0)
CurveLoop = Output(number_3, curves_from_family)
curveelement_reference = CurveRef(CurveLoop)
XYZ_2 = XYZ(number_2, number_2, number_slider_2)
level_5 = Level(number_slider_2)
family_instance_by_level_creator_2 = FamilyInstanceCreatorLevel(XYZ_2, family_type_selector, level_5)
curves_from_family_2 = CurvesFromFamilyInstance(family_instance_by_level_creator_2)
CurveLoop_2 = Output(number_3, curves_from_family_2)  # "CurveLoop"
curveelement_reference_2 = CurveRef(CurveLoop_2)
list = NewList(item_s=curveelement_reference, index1=curveelement_reference_2)
loft_form = LoftForm(boolean_2, list)
watch_3 = Watch(list)
