# Dynamo graph form from curve selection.dyn

boolean = BoolSelector(true)
curves_by_selection = CurvesBySelection()
curve_reference = CurveRef(curves_by_selection)
curves_by_selection_2 = CurvesBySelection()
curve_reference_2 = CurveRef(curves_by_selection_2)
list = NewList(index0=curve_reference, index1=curve_reference_2)
loft_form = LoftForm(boolean, list)
