# Dynamo graph graph function.dyn

number = DoubleInput(0)
number_2 = DoubleInput(2)
π = Pi()
multiplication = Multiplication(number_2, π)
number_3 = DoubleInput(16)
division = Division(π, number_3)
number_4 = DoubleInput(2)
sine = Sin()
C_f_x = Output(number_4, sine)  # "C * f(x)"
GraphFunction = Output(number, multiplication, division, C_f_x)
