# Dynamo graph ref grid sliders.dyn

number_slider = DoubleSliderInput(10)
number = DoubleInput(1)
number_2 = DoubleInput(0)
number_slider_2 = DoubleSliderInput(30)
number_slider_3 = DoubleSliderInput(19)
number_3 = DoubleInput(0)
xyz_grid = ReferencePtGrid(number_slider, number_slider, number, number_2, number_2, number_2, number_slider_2, number_slider_3, number_3)
reference_point = ReferencePointByXYZ(xyz_grid)
