# Dynamo graph Dynamic Relaxation Loop.dyf "Dynamic Relaxation Loop RefPoints"
# category: Miscellaneous

ps = Input()
number = DoubleInput(0.6)
exec = Input()
dynamic_relaxation_step = DynamicRelaxationStep(ps, number, exec)
watch_3d = dyn3DPreview(dynamic_relaxation_step)
pause = Pause(exec)
Dynamic_Relaxation_Loop = Output(ps, exec)
perform_all = Begin(expr1=watch_3d, expr2=pause, expr3=Dynamic_Relaxation_Loop)
