# Dynamo graph dynRelaxationTest2.dyn

number = DoubleInput(0)
number_2 = DoubleInput(1)
number_3 = DoubleInput(10)
number_4 = DoubleInput(20)
number_5 = DoubleInput(1)
number_slider = DoubleSliderInput(10, range=0..10)
create_particle_system = DynamicRelaxation(number, number, number_2, number_3, number_4, number_5, number_slider)
number_6 = DoubleInput(0.1)
number_7 = DoubleInput(10)
execution_interval = ExecuteInterval(number_7)
dynamic_relaxation_step = DynamicRelaxationStep(create_particle_system, number_6, execution_interval)
watch_3d = dyn3DPreview(dynamic_relaxation_step)
