# Dynamo graph dynRelaxationTest6 refpoints.dyn

number = DoubleInput(0.1)
dynamic_relaxation_step = DynamicRelaxationStep()
watch_3d = dyn3DPreview(dynamic_relaxation_step)
number_2 = DoubleInput(0)
number_3 = DoubleInput(1)
number_4 = DoubleInput(10)
number_5 = DoubleInput(15)
number_6 = DoubleInput(10)
number_slider = DoubleSliderInput(10.18181818, range=0..20)
number_slider_2 = DoubleSliderInput(1, range=1..10)
create_particle_system = DynamicRelaxation(number_2, number_2, number_3, number_4, number_5, number_6, number_slider, number_slider_2)
number_7 = DoubleInput(0.1)
execution_interval = ExecuteInterval(number_7)
Dynamic_Relaxation_Loop_RefPoints = Output(create_particle_system, execution_interval)
