# Dynamo graph watch 3d relax 2.dyn

number = DoubleInput(0)
number_2 = DoubleInput(1)
execution_interval = ExecuteInterval(number_2)
number_3 = DoubleInput(1)
number_4 = DoubleInput(2500)
# note: double maxLength = 2;
# int maxPart = 20;
# double stepSize = maxLength/maxPart;
# double mass = 1;
# double springDampening = 1;
# double springRestLength = stepSize/1;
# double springConstant = 2500;
# mParticleSystem.step(0.0002);
number_5 = DoubleInput(0.1)
create_particle_system = DynamicRelaxation(number, number, execution_interval, number_3, number_4, number_5)
Dynamic_Relaxation_Loop = Output(create_particle_system)
watch_3d = dyn3DPreview(Dynamic_Relaxation_Loop)
