# Dynamo graph point on face.dyn

face_by_selection = FormElementBySelection()
number = DoubleInput(0.5)
reference_point_on_face = PointOnFace(face_by_selection, number, number)
debug_breakpoint = Breakpoint(reference_point_on_face)
