# Dynamo graph ellipse.dyn

number_slider = DoubleSliderInput(0, range=0..100)
number = DoubleInput(0)
XYZ = XYZ(number_slider, number, number)
number_slider_2 = DoubleSliderInput(30.90909091, range=0..200)
number_slider_3 = DoubleSliderInput(200, range=0..200)
ellipse = Ellipse(XYZ, number_slider_2, number_slider_3)
xyz_basisz = XYZBasisZ()
plane = Plane(xyz_basisz, XYZ)
sketch_plane = SketchPlane(plane)
model_curve = ModelCurve(ellipse, sketch_plane)
curve_by_selection = CurvesBySelection()  # 1 picked in the model
curve_from_curve_element = CurveFromModelCurve(curve_by_selection)
list = NewList(item_s=ellipse, index1=curve_from_curve_element)
watch_3d = dyn3DPreview(list)
