# Dynamo custom node CurveLoop.dyf
# Copyright Autodesk, Inc. 2012. All rights reserved.
# Licensed under the Apache License, Version 2.0 (the "License");
# you may not use this file except in compliance with the License.
# You may obtain a copy of the License at
# http://www.apache.org/licenses/LICENSE-2.0
# Unless required by applicable law or agreed to in writing, software
# distributed under the License is distributed on an "AS IS" BASIS,
# WITHOUT WARRANTIES OR CONDITIONS OF ANY KIND, either express or implied.
# See the License for the specific language governing permissions and
# limitations under the License.
# category: Scripting.Custom Nodes

number = DoubleInput(0)
number_2 = DoubleInput(1)
XYZ = XYZ(number, number, number_2)
originZ = Input()
XYZ_2 = XYZ(number, number, originZ)
plane = Plane(XYZ, XYZ_2)
sketch_plane = SketchPlane(plane)
model_curve = ModelCurve(arg1=sketch_plane)
fi = Input()
curves_from_family = CurvesFromFamilyInstance(fi)
map = Map(model_curve, curves_from_family)
watch = Watch(map)
curveelement_reference = CurveRef(watch)
