# Dynamo custom node Dynamic Relaxation Loop.dyf
# category: Analyze.Structure

ps = Input()
number = DoubleInput(0.5)
exec = Input()
dynamic_relaxation_step = DynamicRelaxationStep(ps, number, exec)
watch = Watch(dynamic_relaxation_step)
watch_3d = Watch3D(watch)
number_2 = DoubleInput(1)
pause = Pause(number_2)
dynamic_relaxation_loop = Custom[Dynamic Relaxation Loop](ps=ps, exec=exec)
perform_all = Begin(expr1=watch_3d, expr2=pause, expr3=dynamic_relaxation_loop)
