# Dynamo custom node DynamicRelaxationLoop.dyf
# category: DynamicRelaxation

ps = Input()
number = DoubleInput(0.002)
update = Input()
dynamic_relaxation_step = DynamicRelaxationStep(ps, number, update)
pause = Pause(update)
dynamicRelaxationLoop = Custom[DynamicRelaxationLoop](ps=ps, update=update)
perform_all = Begin(expr1=dynamic_relaxation_step, expr2=pause, expr3=dynamicRelaxationLoop)
