# Dynamo custom node Family Instance Creator - Indexed.dyf
# Copyright David Wood 2012. Derived from http://revitator.blogspot.co.uk/2012/10/dynamo-indexed-family-instances.html
# Licensed under the Apache License, Version 2.0 (the "License");
# you may not use this file except in compliance with the License.
# You may obtain a copy of the License at
# http://www.apache.org/licenses/LICENSE-2.0
# Unless required by applicable law or agreed to in writing, software
# distributed under the License is distributed on an "AS IS" BASIS,
# WITHOUT WARRANTIES OR CONDITIONS OF ANY KIND, either express or implied.
# See the License for the specific language governing permissions and
# limitations under the License.
# category: Scripting.Custom Nodes

xyz_zero = XYZZero()
typ = Input()
family_instance_creator = FamilyInstanceCreatorXYZ(xyz_zero, typ)
param = Input()
index = Input()
set_instance_parameter = FamilyInstanceParameterSetter(family_instance_creator, param, index)
string = StringInput("Offset")
number = DoubleInput(0)
set_instance_parameter_2 = FamilyInstanceParameterSetter(set_instance_parameter, string, number)
transaction = Transaction(set_instance_parameter_2)
