# Dynamo custom node GraphFunction.dyf
# Copyright Autodesk, Inc. 2012. All rights reserved.
# Licensed under the Apache License, Version 2.0 (the "License");
# you may not use this file except in compliance with the License.
# You may obtain a copy of the License at
# http://www.apache.org/licenses/LICENSE-2.0
# Unless required by applicable law or agreed to in writing, software
# distributed under the License is distributed on an "AS IS" BASIS,
# WITHOUT WARRANTIES OR CONDITIONS OF ANY KIND, either express or implied.
# See the License for the specific language governing permissions and
# limitations under the License.
# category: Scripting.Custom Nodes

number = DoubleInput(0)
XYZ = XYZ(arg2=number)
x_start = Input()  # "x-start"
x_end = Input()  # "x-end"
x_step = Input()  # "x-step"
build_sequence = BuildSeq(x_start, x_end, x_step)
y = Input(y = f(x))
map = Map(y, build_sequence)
combine = Combine(XYZ, build_sequence, map)
