# Dynamo custom node chomp.dyf
# Copyright 2012 Ian Keough
# Licensed under the Apache License, Version 2.0 (the "License");
# you may not use this file except in compliance with the License.
# You may obtain a copy of the License at
# http://www.apache.org/licenses/LICENSE-2.0
# Unless required by applicable law or agreed to in writing, software
# distributed under the License is distributed on an "AS IS" BASIS,
# WITHOUT WARRANTIES OR CONDITIONS OF ANY KIND, either express or implied.
# See the License for the specific language governing permissions and
# limitations under the License.
# category: Scripting.Custom Nodes

lst = Input()
count = Length(lst)
chmp = Input()
gt = GreaterThan(count, chmp)
strt = Input()
get = GetFromList(strt, lst)
get_2 = GetFromList(chmp, lst)
list = NewList(item_s=get, index1=get_2)
number = DoubleInput(1)
drop = DropList(number, lst)
chomp = Function(drop, chmp, strt)
cons = List(list, chomp)
empty = Empty()
if_ = Conditional(gt, cons, empty)
