# Dynamo custom node dice.dyf "Dice"
# Copyright 2012 Ian Keough
# Licensed under the Apache License, Version 2.0 (the "License");
# you may not use this file except in compliance with the License.
# You may obtain a copy of the License at
# http://www.apache.org/licenses/LICENSE-2.0
# Unless required by applicable law or agreed to in writing, software
# distributed under the License is distributed on an "AS IS" BASIS,
# WITHOUT WARRANTIES OR CONDITIONS OF ANY KIND, either express or implied.
# See the License for the specific language governing permissions and
# limitations under the License.
# category: Scripting.Custom Nodes

lst = Input()
is_empty = IsEmpty(lst)
empty = Empty()
amt = Input()
take = TakeList(amt, lst)
drop = DropList(amt, lst)
dice = Function(drop, amt)
cons = List(take, dice)
if_ = Conditional(is_empty, empty, cons)
