# Dynamo custom node solarradopt.dyf
# Copyright Autodesk, Inc. 2012. All rights reserved.
# Licensed under the Apache License, Version 2.0 (the "License");
# you may not use this file except in compliance with the License.
# You may obtain a copy of the License at
# http://www.apache.org/licenses/LICENSE-2.0
# Unless required by applicable law or agreed to in writing, software
# distributed under the License is distributed on an "AS IS" BASIS,
# WITHOUT WARRANTIES OR CONDITIONS OF ANY KIND, either express or implied.
# See the License for the specific language governing permissions and
# limitations under the License.
# category: Scripting.Custom Nodes

max = Input()
amt = Input()
greaterthanequals = GreaterThanEquals(max, amt)
fw = Input()
reset_file_watcher = FileWatcherReset(fw)
fI = Input()
p = Input()
set_instance_parameter = FamilyInstanceParameterSetter(fI, p, amt)
transaction = Transaction(set_instance_parameter)
number = DoubleInput(5000)
wait_for_change = FileWatcherWait(fw, number)
i = Input()
add = Addition(i, amt)
acc = Input()
path = Input()
read_file = FileReader(path)
extract_solar_radiation_value = ComputeSolarRadiationValue(read_file)
solarradcomp = Function(acc, extract_solar_radiation_value, amt)
solarradopt = Function(fI, p, i, max, add, solarradcomp, path, fw)
begin = Begin(expr1=reset_file_watcher, expr2=transaction, expr3=wait_for_change, expr4=solarradopt)
if_ = Conditional(greaterthanequals, begin, acc)
