# Dynamo graph 3JO6UW566EG3MSCU25AGJTTDKZSMAZZO7D4VC5APLFDZVUEMPDSA.dyn (Dynamo 1.1.0.2093)

origin = Point.Origin()
byOriginVectors = CoordinateSystem.ByOriginVectors(origin=origin)
code_block = CodeBlock { Point.ByCoordinates(2,3); }
code_block_2 = CodeBlock { 1; }
byCoordinates = Vector.ByCoordinates(y=code_block_2)
rotation_degrees = DoubleSlider(47.8, range=0..100 step 0.1)
rotate = CoordinateSystem.Rotate(coordinateSystem=byOriginVectors, origin=code_block, axis=byCoordinates, degrees=rotation_degrees)
