# Dynamo graph 43XHCR2GSF5A34R3G2P7OGOWDWYKS3WCXART33FSES5M5ZF2MHJA.dyn "Autodesk.DesignScript.Geometry.CoordinateSystem.Transform(coordinateSystem, fromCoordinateSystem, contextCoordinateSystem)" (Dynamo 2.17.0.3255)

number_slider = DoubleSlider(3.3, range=0..5 step 0.1)  # graph input
number_slider_2 = DoubleSlider(2, range=0..5 step 0.1)  # graph input
byOrigin = CoordinateSystem.ByOrigin(x=number_slider, y=number_slider_2)
number_slider_3 = DoubleSlider(1.1, range=0..5 step 0.1)  # graph input
number_slider_4 = DoubleSlider(3.1, range=0..5 step 0.1)  # graph input
byOrigin_2 = CoordinateSystem.ByOrigin(x=number_slider_3, y=number_slider_4)
transform = CoordinateSystem.Transform(coordinateSystem=byOrigin, coordinateSystem_2=byOrigin_2)
byRadiusHeight = Cylinder.ByRadiusHeight(coordinateSystem=transform)
code_block = CodeBlock(geometry=byRadiusHeight) { color = Color.ByARGB(100,141,198,217); Modifiers.GeometryColor.ByGeometryColor(geometry, color); }
