# Dynamo graph 6ICXLN4V6DNK5KMYTY5LPCJBE27IRW5VOBKCCVFQGO3HST752ZNQ.dyn (Dynamo 2.19.3.6543)

# note: Curve

# group: T-Spline Surface
code_block = CodeBlock { 10; 25; }
byCoordinates = Point.ByCoordinates(x=code_block.out0, y=code_block.out1)
code_block_2 = CodeBlock { 15; }
byCoordinates_2 = Point.ByCoordinates(y=code_block_2)
code_block_3 = CodeBlock { 3; }
boolean = BoolSelector(true)
byPlaneOriginNormal = TSpline.TSplineSurface.ByPlaneOriginNormal(minCorner=byCoordinates, maxCorner=byCoordinates_2, xSpans=code_block_3, ySpans=code_block_3, inSmoothMode=boolean)
code_block_4 = CodeBlock { [0,3]; }
vertexByIndex = TSpline.TSplineTopology.VertexByIndex(tSplineTopology=byPlaneOriginNormal, index=code_block_4)
deleteVertices = TSpline.TSplineSurface.DeleteVertices(tSplineSurface=byPlaneOriginNormal, vertices=vertexByIndex)
code_block_5 = CodeBlock { [13,14,10,9]; }
vertexByIndex_2 = TSpline.TSplineTopology.VertexByIndex(tSplineTopology=deleteVertices, index=code_block_5)
code_block_6 = CodeBlock { 4; }
byCoordinates_3 = Vector.ByCoordinates(z=code_block_6)
moveVertices = TSpline.TSplineSurface.MoveVertices(tSplineSurface=deleteVertices, vertices=vertexByIndex_2, vector=byCoordinates_3)

t_spline_surface = CodeBlock(TSpline_surface=moveVertices) { TSpline_surface; }
code_block_7 = CodeBlock { [9,10,11]; }
edgeByIndex = TSpline.TSplineTopology.EdgeByIndex(tSplineTopology=moveVertices, index=code_block_7)

# group: Curve
nurbs_curve = CodeBlock()
# ---------- nurbs_curve.designscript (7 lines) ----------
point1 = Point.ByCoordinates(15, 4, 0);
point2 = Point.ByCoordinates(12, 1, 6);
point3 = Point.ByCoordinates(5, 1, 5);
point4 = Point.ByCoordinates(0.5, 0.2, 0);
point5 = Point.ByCoordinates(-5, 0.4, 0);
pts_list = List.Join([point1, point2, point3, point4, point5]);
nurbsCurve1 = NurbsCurve.ByPoints(pts_list);
# ----------------------------------------

curve = CodeBlock(NURBS_curve=nurbs_curve.nurbsCurve1) { NURBS_curve; }
continuity = CodeBlock { 0; }
boolean_2 = BoolSelector(true)
boolean_3 = BoolSelector(true)
refinement = CodeBlock { 4; 0.01; }
boolean_4 = BoolSelector(true)
integer_slider = IntegerSlider(3, range=0..10 step 1)
boolean_5 = BoolSelector(false)
createMatch = TSpline.TSplineSurface.CreateMatch(tSplineSurface=t_spline_surface, tsEdges=edgeByIndex, curves=curve, continuity=continuity, useArclength=boolean_2, useRefinement=boolean_3, numRefinementSteps=refinement.out0, refinementTolerance=refinement.out1, usePropagation=boolean_4, widthOfPropagation=integer_slider, flipSourceTargetAlignment=boolean_5)
