# Dynamo graph ==.dyn (Dynamo 2.19.0.5742)

number_slider = DoubleSlider(54, range=0..100 step 1)  # graph input
number_slider_2 = DoubleSlider(5, range=0..10 step 1)  # graph input
eq = number_slider == number_slider_2
watch = Watch(eq)
