# Dynamo graph Autodesk.DesignScript.Geometry.BoundingBox.ByCorners.dyn "ByCorners" (Dynamo 2.0.1.5055)

origin = Point.Origin()
code_block = CodeBlock { 5; 2; 6; }
byCoordinates = Vector.ByCoordinates(x=code_block.out0, y=code_block.out1, z=code_block.out2)
number_slider = DoubleSlider(14.3, range=0..100 step 0.1)  # graph input
translate = Geometry.Translate(geometry=origin, direction=byCoordinates, distance=number_slider)
byCorners = BoundingBox.ByCorners(min=origin, max=translate)
toPolySurface = BoundingBox.ToPolySurface(boundingBox=byCorners)
edges = Topology.Edges(topology=toPolySurface)
curveGeometry = Edge.CurveGeometry(edge=edges)
