# Dynamo graph Autodesk.DesignScript.Geometry.Circle.ByCenterPointRadius.dyn "ByCenterPointRadius" (Dynamo 2.0.1.5055)

code_block = CodeBlock { 1; 2; 0; }
byCoordinates = Point.ByCoordinates(x=code_block.out0, y=code_block.out1, z=code_block.out2)
number_slider = DoubleSlider(1, range=0..100 step 0.1)  # graph input
byCenterPointRadius = Circle.ByCenterPointRadius(centerPoint=byCoordinates, radius=number_slider)
