# Dynamo graph Autodesk.DesignScript.Geometry.CoordinateSystem.ByOrigin(x, y, z).dyn "ByOrigin" (Dynamo 2.0.1.5055)

code_block = CodeBlock { 4; }
code_block_2 = CodeBlock { 2; }
code_block_3 = CodeBlock { 1; }
byOrigin = CoordinateSystem.ByOrigin(x=code_block, y=code_block_2, z=code_block_3)
watch = Watch(byOrigin)
