# Dynamo graph Autodesk.DesignScript.Geometry.CoordinateSystem.ByOriginVectors(origin, xAxis, yAxis, zAxis).dyn "ByOriginVectors" (Dynamo 2.0.1.5055)

code_block = CodeBlock { 2; }
byCoordinates = Point.ByCoordinates(x=code_block, y=code_block, z=code_block)
code_block_2 = CodeBlock { 2; }
byCoordinates_2 = Vector.ByCoordinates(x=code_block_2, y=code_block_2, z=code_block_2)
code_block_3 = CodeBlock { 1; }
code_block_4 = CodeBlock { 2; }
byCoordinates_3 = Vector.ByCoordinates(x=code_block_3, y=code_block_3, z=code_block_4)
byOriginVectors = CoordinateSystem.ByOriginVectors(origin=byCoordinates, xAxis=byCoordinates_2, yAxis=byCoordinates_3)
watch = Watch(byOriginVectors)
