# Dynamo graph Autodesk.DesignScript.Geometry.CoordinateSystem.Rotate(plane, degrees).dyn (Dynamo 1.1.0.2093)

origin = Point.Origin()
byOriginVectors = CoordinateSystem.ByOriginVectors(origin=origin)
code_block = CodeBlock { Point.ByCoordinates(2,2,0); }
code_block_2 = CodeBlock { 1; }
byCoordinates = Vector.ByCoordinates(x=code_block_2, y=code_block_2, z=code_block_2)
byOriginNormal = Plane.ByOriginNormal(origin=code_block, normal=byCoordinates)
rotation_degrees = DoubleSlider(35.4, range=0..100 step 0.1)
rotate = CoordinateSystem.Rotate(byOriginVectors, byOriginNormal, rotation_degrees)
