# Dynamo graph Autodesk.DesignScript.Geometry.CoordinateSystem.Scale1D.dyn (Dynamo 1.1.0.2093)

number_slider = DoubleSlider(18.1, range=7..20 step 0.1)
code_block = CodeBlock(x=number_slider) { Point.ByCoordinates(2,0,0); Vector.ByCoordinates(4,0,0); Point.ByCoordinates(1,2,0); Point.ByCoordinates(x,0,0); }
byOriginNormal = Plane.ByOriginNormal(origin=code_block.out0, normal=code_block.out1)
origin = Point.Origin()
scale1D = CoordinateSystem.Scale1D(byOriginNormal, origin, code_block.out2, code_block.out3)
watch = Watch(scale1D)
code_block_2 = CodeBlock(plane1=byOriginNormal, plane2=scale1D) { Ellipse.ByPlaneRadii({plane1,plane2},2,1); }
byLoft = Solid.ByLoft(code_block_2)
code_block_3 = CodeBlock(geometry=byLoft) { color = Color.ByARGB(100,141,198,217); Display.ByGeometryColor(geometry, color); }
