# Dynamo graph Autodesk.DesignScript.Geometry.CoordinateSystem.Scale2D.dyn (Dynamo 2.17.0.3255)

number_slider = DoubleSlider(6.6, range=0..15 step 0.1)  # graph input
code_block = CodeBlock(x=number_slider) { Point.ByCoordinates(4,1,0); Vector.ByCoordinates(4,1,0); Point.ByCoordinates(1,2,0); Point.ByCoordinates(3,x,0); }
byOriginNormal = Plane.ByOriginNormal(origin=code_block.out0, normal=code_block.out1)
byPlane = CoordinateSystem.ByPlane(plane=byOriginNormal)
XY = Plane.XY()
scale2D = CoordinateSystem.Scale2D(coordinateSystem=byPlane, basePlane=XY, from=code_block.out2, to=code_block.out3)
watch = Watch(scale2D)
