# Dynamo graph Autodesk.DesignScript.Geometry.CoordinateSystem.Transform(coordinateSystem, fromCoordinateSystem, contextCoordinateSystem).dyn (Dynamo 1.1.0.2093)

number_slider = DoubleSlider(3.3, range=0..5 step 0.1)
number_slider_2 = DoubleSlider(2, range=0..5 step 0.1)
byOrigin = CoordinateSystem.ByOrigin(x=number_slider, y=number_slider_2)
number_slider_3 = DoubleSlider(1.1, range=0..5 step 0.1)
number_slider_4 = DoubleSlider(3.1, range=0..5 step 0.1)
byOrigin_2 = CoordinateSystem.ByOrigin(x=number_slider_3, y=number_slider_4)
transform = CoordinateSystem.Transform(byOrigin, byOrigin_2)
byRadiusHeight = Cylinder.ByRadiusHeight(transform)
code_block = CodeBlock(geometry=byRadiusHeight) { color = Color.ByARGB(100,141,198,217); Display.ByGeometryColor(geometry, color); }
