# Dynamo graph Autodesk.DesignScript.Geometry.CoordinateSystem.Translate(direction).dyn (Dynamo 1.1.0.2093)

byOrigin = CoordinateSystem.ByOrigin()
x_position = DoubleSlider(3.8, range=0..5 step 0.1)
y_position = DoubleSlider(2.7, range=0..5 step 0.1)
byCoordinates = Vector.ByCoordinates(x=x_position, y=y_position)
translate = CoordinateSystem.Translate(byOrigin, byCoordinates)
byRadiusHeight = Cylinder.ByRadiusHeight(translate)
code_block = CodeBlock(geometry=byRadiusHeight) { color = Color.ByARGB(100,141,198,217); Display.ByGeometryColor(geometry, color); }
