# Dynamo graph Autodesk.DesignScript.Geometry.CoordinateSystem.Translate(direction, distance).dyn (Dynamo 1.1.0.2093)

byOrigin = CoordinateSystem.ByOrigin()
number_slider = DoubleSlider(3.1, range=0..5 step 0.1)
number_slider_2 = DoubleSlider(4.1, range=0..5 step 0.1)
byCoordinates = Vector.ByCoordinates(x=number_slider, y=number_slider_2)
number_slider_3 = DoubleSlider(3, range=0..4 step 0.1)
translate = CoordinateSystem.Translate(byOrigin, byCoordinates, number_slider_3)
byRadiusHeight = Cylinder.ByRadiusHeight(translate)
code_block = CodeBlock(geometry=byRadiusHeight) { color = Color.ByARGB(100,141,198,217); Display.ByGeometryColor(geometry, color); }
