# Dynamo graph Autodesk.DesignScript.Geometry.CoordinateSystem.Translate(xTranslation, yTranslation, zTranslation).dyn (Dynamo 2.17.0.3255)

byOrigin = CoordinateSystem.ByOrigin()
number_slider = DoubleSlider(3.8, range=0..5 step 0.1)  # graph input
number_slider_2 = DoubleSlider(2.7, range=0..5 step 0.1)  # graph input
number_slider_3 = DoubleSlider(0.8, range=0..4 step 0.1)  # graph input
translate = CoordinateSystem.Translate(coordinateSystem=byOrigin, xTranslation=number_slider, yTranslation=number_slider_2, zTranslation=number_slider_3)
byRadiusHeight = Cylinder.ByRadiusHeight(coordinateSystem=translate)
code_block = CodeBlock(geometry=byRadiusHeight) { color = Color.ByARGB(100,141,198,217); Modifiers.GeometryColor.ByGeometryColor(geometry, color); }
