# Dynamo graph Autodesk.DesignScript.Geometry.Cuboid.ByLengths(width, length, height).dyn "ByLengths" (Dynamo 2.0.1.5055)

number_slider = DoubleSlider(7.3, range=0..20 step 0.1)  # graph input
number_slider_2 = DoubleSlider(11.8, range=0..20 step 0.1)  # graph input
number_slider_3 = DoubleSlider(5.7, range=0..20 step 0.1)  # graph input
byLengths = Cuboid.ByLengths(width=number_slider, length=number_slider_2, height=number_slider_3)
