# Dynamo graph Autodesk.DesignScript.Geometry.Cuboid.Height.dyn "Height" (Dynamo 2.0.1.5055)

code_block = CodeBlock { 2; }
randomList = Math.RandomList(amount=code_block)
code_block_2 = CodeBlock(x=randomList) { x*12; }
randomList_2 = Math.RandomList(amount=code_block)
code_block_3 = CodeBlock(x=randomList_2) { x*12; }
randomList_3 = Math.RandomList(amount=code_block)
code_block_4 = CodeBlock(x=randomList_3) { x*12; }
byCoordinates = Point.ByCoordinates(x=code_block_2, y=code_block_3, z=code_block_4)
code_block_5 = CodeBlock { 0; 1; }
getItemAtIndex = List.GetItemAtIndex(list=byCoordinates, index=code_block_5.out0)
getItemAtIndex_2 = List.GetItemAtIndex(list=byCoordinates, index=code_block_5.out1)
byCorners = Cuboid.ByCorners(lowPoint=getItemAtIndex, highPoint=getItemAtIndex_2)
height = Cuboid.Height(cuboid=byCorners)
