# Dynamo graph Autodesk.DesignScript.Geometry.Curve.Offset.dyn (Dynamo 2.17.0.3255)

code_block = CodeBlock { 6; }
randomList = Math.RandomList(amount=code_block)
code_block_2 = CodeBlock(x=randomList) { x*10; }
randomList_2 = Math.RandomList(amount=code_block)
code_block_3 = CodeBlock(x=randomList_2) { x*10; }
byCoordinates = Point.ByCoordinates(x=code_block_2, y=code_block_3)
boolean = BoolSelector(true)
byPoints = PolyCurve.ByPoints(points=byCoordinates, connectLastToFirst=boolean)
number_slider = DoubleSlider(0.7, range=-1..1 step 0.01)  # graph input
boolean_2 = BoolSelector(false)
offsetMany = PolyCurve.OffsetMany(polyCurve=byPoints, signedDistance=number_slider, extendCircular=boolean_2)
