# Dynamo graph Autodesk.DesignScript.Geometry.Curve.ToNurbsCurve.dyn "ToNurbsCurve" (Dynamo 2.0.1.5055)

code_block = CodeBlock { Point.Origin(); Point.ByCoordinates(0,5,3); Point.ByCoordinates(0,10,0); }
byThreePoints = Arc.ByThreePoints(firstPoint=code_block.out0, secondPoint=code_block.out1, thirdPoint=code_block.out2)
toNurbsCurve = Curve.ToNurbsCurve(curve=byThreePoints)
