# Dynamo graph Autodesk.DesignScript.Geometry.Cylinder.ByRadiusHeight.dyn "ByRadiusHeight" (Dynamo 2.0.1.5055)

code_block = CodeBlock { 4; }
byCoordinates = Point.ByCoordinates(x=code_block, y=code_block)
code_block_2 = CodeBlock { Vector.ByCoordinates(1,4,1); }
byOriginVectors = CoordinateSystem.ByOriginVectors(origin=byCoordinates, yAxis=code_block_2)
number_slider = DoubleSlider(2.8, range=0..100 step 0.1)  # graph input
number_slider_2 = DoubleSlider(3.4, range=0..100 step 0.1)  # graph input
byRadiusHeight = Cylinder.ByRadiusHeight(cs=byOriginVectors, radius=number_slider, height=number_slider_2)
code_block_3 = CodeBlock(geometry=byRadiusHeight) { color = Color.ByARGB(100,141,198,217); GeometryColor.ByGeometryColor(geometry, color); }
