# Dynamo graph Autodesk.DesignScript.Geometry.Edge.StartVertex.dyn "StartVertex" (Dynamo 2.0.1.5055)

code_block = CodeBlock { 5; }
byCenterPointRadius = Circle.ByCenterPointRadius(radius=code_block)
code_block_2 = CodeBlock { 6; }
regularPolygon = Polygon.RegularPolygon(circle=byCenterPointRadius, numberSides=code_block_2)
byPatch = Surface.ByPatch(closedCurve=regularPolygon)
code_block_3 = CodeBlock(geometry=byPatch) { color = Color.ByARGB(100,141,198,217); GeometryColor.ByGeometryColor(geometry, color); }
faces = Topology.Faces(topology=byPatch)
edges = Face.Edges(face=faces)
code_block_4 = CodeBlock { 4; }
getItemAtIndex = List.GetItemAtIndex(list=edges@L2, index=code_block_4)
startVertex = Edge.StartVertex(edge=getItemAtIndex)
