# Dynamo graph Autodesk.DesignScript.Geometry.Ellipse.CenterPoint.dyn "CenterPoint" (Dynamo 2.0.1.5055)

YZ = Plane.YZ()
number_slider = DoubleSlider(5.5, range=0..20 step 0.1)  # graph input
number_slider_2 = DoubleSlider(6.4, range=0..20 step 0.1)  # graph input
byPlaneRadii = Ellipse.ByPlaneRadii(plane=YZ, xAxisRadius=number_slider, yAxisRadius=number_slider_2)
centerPoint = Ellipse.CenterPoint(ellipse=byPlaneRadii)
