# Dynamo graph Autodesk.DesignScript.Geometry.EllipseArc.MinorAxis.dyn "MinorAxis" (Dynamo 2.0.1.5055)

XY = Plane.XY()
number_slider = DoubleSlider(9.4, range=0..20 step 0.1)  # graph input
number_slider_2 = DoubleSlider(8.6, range=0..20 step 0.1)  # graph input
number_slider_3 = DoubleSlider(8.6, range=0..20 step 0.1)  # graph input
number_slider_4 = DoubleSlider(271.1, range=0..360 step 0.1)  # graph input
byPlaneRadiiAngles = EllipseArc.ByPlaneRadiiAngles(plane=XY, xRadius=number_slider, yRadius=number_slider_2, startAngle=number_slider_3, sweepAngle=number_slider_4)
minorAxis = EllipseArc.MinorAxis(ellipseArc=byPlaneRadiiAngles)
