# Dynamo graph Autodesk.DesignScript.Geometry.Geometry.DeserializeFromSAB.dyn (Dynamo 1.1.0.2093)

file_path = Filename("..\..\..\..\_REFERENCE\SABsample.xlsx")
fromPath = FileObject(file_path)  # "File.FromPath"
code_block = CodeBlock { "Sheet1"; }
readFromFile = Excel.ReadFromFile(file=fromPath, sheetName=code_block)
watch = Watch(readFromFile)
code_block_2 = CodeBlock { 1; }
flatten = List.Flatten(list=watch, amt=code_block_2)
deserializeFromSAB = Geometry.DeserializeFromSAB(flatten)
