# Dynamo graph Autodesk.DesignScript.Geometry.Geometry.ExportToSAT(geometry, filePath).dyn "Autodesk.DesignScript.Geometry.Geometry.ExportToSAT" (Dynamo 2.19.0.5874)

code_block = CodeBlock { 5; 2; 8; }
byCoordinates = Point.ByCoordinates(x=code_block.out0, y=code_block.out1, z=code_block.out2)
code_block_2 = CodeBlock { 5; }
byCenterPointRadius = Sphere.ByCenterPointRadius(centerPoint=byCoordinates, radius=code_block_2)
code_block_3 = CodeBlock { 1; 2; 3; }
byCoordinates_2 = Point.ByCoordinates(x=code_block_3.out0, y=code_block_3.out1, z=code_block_3.out2)
byCenterPointRadius_2 = Sphere.ByCenterPointRadius(centerPoint=byCoordinates_2, radius=code_block_2)
code_block_4 = CodeBlock { 5; 1; 4; }
byCoordinates_3 = Point.ByCoordinates(x=code_block_4.out0, y=code_block_4.out1, z=code_block_4.out2)
byCenterPointRadius_3 = Sphere.ByCenterPointRadius(centerPoint=byCoordinates_3, radius=code_block_2)
join = List.Join(list0=byCenterPointRadius_2, list1=byCenterPointRadius_3)
intersectAll = Geometry.IntersectAll(geometry=byCenterPointRadius, others=join)
file_path = Filename("No file selected.")  # graph input
exportToSAT = Geometry.ExportToSAT(geometry=intersectAll, filePath=file_path)
