# Dynamo graph Autodesk.DesignScript.Geometry.Geometry.ImportFromSAT(file).dyn (Dynamo 1.0.0.1180)

string = StringInput("C:\Users\Username\Desktop\example.sat")
importFromSAT = Geometry.ImportFromSAT(string)
string_2 = StringInput("C:\Users\Christopher\Desktop\test.sat")
importFromSAT_2 = Geometry.ImportFromSAT(string_2)
file_path = Filename("No file selected.")
importFromSAT_3 = Geometry.ImportFromSAT(file_path)
