# Dynamo graph Autodesk.DesignScript.Geometry.Geometry.Rotate(basePlane, degrees).dyn "Rotate" (Dynamo 2.0.1.5055)

origin = Point.Origin()
code_block = CodeBlock { 5; 2; 8; }
byCoordinates = Point.ByCoordinates(x=code_block.out0, y=code_block.out1, z=code_block.out2)
byPointsRadius = Cone.ByPointsRadius(startPoint=origin, endPoint=byCoordinates, startRadius=code_block.out0)
XY = Plane.XY()
number_slider = DoubleSlider(62.1, range=1..359 step 0.1)  # graph input
rotate = Geometry.Rotate(geometry=byPointsRadius, basePlane=XY, degrees=number_slider)
