# Dynamo graph Autodesk.DesignScript.Geometry.Geometry.Rotate(geometry, origin, axis, degrees).dyn "Autodesk.DesignScript.Geometry.Geometry.Rotate" (Dynamo 2.19.0.5874)

XY = Plane.XY()
origin = Point.Origin()
code_block = CodeBlock { 5; 2; 8; }
byCoordinates = Point.ByCoordinates(x=code_block.out0, y=code_block.out1, z=code_block.out2)
byPointsRadius = Cone.ByPointsRadius(startPoint=origin, endPoint=byCoordinates, startRadius=code_block.out0)
YAxis = Vector.YAxis()
number_slider = DoubleSlider(44.6, range=1..359 step 0.1)  # graph input
rotate = Geometry.Rotate(geometry=byPointsRadius, origin=byCoordinates, axis=YAxis, degrees=number_slider)
