# Dynamo graph Autodesk.DesignScript.Geometry.Geometry.Scale(basePoint, from, to).dyn "Scale" (Dynamo 2.0.1.5055)

origin = Point.Origin()
code_block = CodeBlock { 5; 2; 8; }
byCoordinates = Point.ByCoordinates(x=code_block.out0, y=code_block.out1, z=code_block.out2)
byPointsRadius = Cone.ByPointsRadius(startPoint=origin, endPoint=byCoordinates, startRadius=code_block.out0)
centroid = Solid.Centroid(solid=byPointsRadius)
scale = Geometry.Scale(geometry=byPointsRadius, basePoint=byCoordinates, from=origin, to=centroid)
vertices = Topology.Vertices(topology=byPointsRadius)
pointGeometry = Vertex.PointGeometry(vertex=vertices)
byBestFitThroughPoints = Line.ByBestFitThroughPoints(bestFitPoints=pointGeometry)
byTwoPoints = Vector.ByTwoPoints(start=origin, end=byCoordinates)
byCenterPointRadiusNormal = Circle.ByCenterPointRadiusNormal(centerPoint=origin, radius=code_block.out0, normal=byTwoPoints)
