# Dynamo graph Autodesk.DesignScript.Geometry.Geometry.Scale(geometry, amount).dyn "Autodesk.DesignScript.Geometry.Geometry.Scale" (Dynamo 2.19.0.5874)

origin = Point.Origin()
code_block = CodeBlock { 5; 2; 8; }
byCoordinates = Point.ByCoordinates(x=code_block.out0, y=code_block.out1, z=code_block.out2)
byPointsRadius = Cone.ByPointsRadius(startPoint=origin, endPoint=byCoordinates, startRadius=code_block.out0)
number_slider = DoubleSlider(0.5, range=0.1..5 step 0.1)  # graph input
scale = Geometry.Scale(geometry=byPointsRadius, amount=number_slider)
vertices = Topology.Vertices(topology=byPointsRadius)
pointGeometry = Vertex.PointGeometry(vertex=vertices)
byBestFitThroughPoints = Line.ByBestFitThroughPoints(bestFitPoints=pointGeometry)
byTwoPoints = Vector.ByTwoPoints(start=origin, end=byCoordinates)
byCenterPointRadiusNormal = Circle.ByCenterPointRadiusNormal(centerPoint=origin, radius=code_block.out0, normal=byTwoPoints)
