# Dynamo graph Autodesk.DesignScript.Geometry.Geometry.SerializeAsSAB.dyn "SerializeAsSAB" (Dynamo 2.0.1.5055)

byCenterPointRadius = Circle.ByCenterPointRadius()
extrudeAsSolid = Curve.ExtrudeAsSolid(curve=byCenterPointRadius)
serializeAsSAB = Geometry.SerializeAsSAB(geometry=extrudeAsSolid)
watch = Watch(serializeAsSAB)
