# Dynamo graph Autodesk.DesignScript.Geometry.Helix.AxisDirection.dyn "AxisDirection" (Dynamo 2.0.1.5055)

code_block = CodeBlock { 3; 5; }
byCoordinates = Point.ByCoordinates(x=code_block.out0, y=code_block.out1)
YAxis = Vector.YAxis()
number_slider = DoubleSlider(4.4, range=0..20 step 0.1)  # graph input
number_slider_2 = DoubleSlider(2.7, range=0..20 step 0.1)  # graph input
number_slider_3 = DoubleSlider(1.8, range=0..20 step 0.1)  # graph input
byCoordinates_2 = Point.ByCoordinates(x=number_slider, y=number_slider_2, z=number_slider_3)
number_slider_4 = DoubleSlider(3.1, range=0..20 step 0.1)  # graph input
number_slider_5 = DoubleSlider(608, range=0..1000 step 0.1)  # graph input
byAxis = Helix.ByAxis(axisPoint=byCoordinates, axisDirection=YAxis, startPoint=byCoordinates_2, pitch=number_slider_4, angleTurns=number_slider_5)
axisDirection = Helix.AxisDirection(helix=byAxis)
