# Dynamo graph Autodesk.DesignScript.Geometry.Mesh.ExtrudedPolyCurve.dyn "Autodesk.DesignScript.Geometry.Mesh.ExtrudedPolyCurve(variant with random polycurve)" (Dynamo 2.6.1.8786)
# packages: MeshToolkit 3.0.0

byCoordinates = Point.ByCoordinates()
byCenterPointRadius = Circle.ByCenterPointRadius(centerPoint=byCoordinates)
code_block = CodeBlock { 0..0.95..0.05; }
pointAtParameter = Curve.PointAtParameter(curve=byCenterPointRadius, param=code_block)
byTwoPoints = Vector.ByTwoPoints(start=byCoordinates, end=pointAtParameter)
code_block_2 = CodeBlock { [0,0.5]; }
code_block_3 = CodeBlock { 15; }
cycle = List.Cycle(list=code_block_2, amount=code_block_3)
translate = Geometry.Translate(geometry=pointAtParameter, direction=byTwoPoints, distance=cycle)
boolean = BoolSelector(true)
byPoints = PolyCurve.ByPoints(points=translate, connectLastToFirst=boolean)
code_block_4 = CodeBlock { 1; }
ZAxis = Vector.ZAxis()
boolean_2 = BoolSelector(false)
extrudePolyCurve = Mesh.ExtrudePolyCurve(polycurve=byPoints, height=code_block_4, direction=ZAxis, cap=boolean_2)
triangles = Mesh.Triangles(mesh=extrudePolyCurve)
