# Dynamo graph Autodesk.DesignScript.Geometry.Mesh.TrianglesAsNineNumbers.dyn (Dynamo 2.6.1.8786)
# packages: MeshToolkit 3.0.0

file_path = Filename("Example Bunny\stanford_bunny_tri.obj")  # graph input
importFile = Mesh.ImportFile(fileName=file_path)
firstItem = List.FirstItem(list=importFile)
triangleCount = Mesh.TriangleCount(mesh=firstItem)
watch = Watch(triangleCount)
trianglesAsNineNumbers = Mesh.TrianglesAsNineNumbers(mesh=firstItem)
watch_2 = Watch(trianglesAsNineNumbers)
code_block = CodeBlock { 3; }
chop = List.Chop(list=trianglesAsNineNumbers, lengths=code_block)
code_block_2 = CodeBlock { 0; 1; 2; }
getItemAtIndex = List.GetItemAtIndex(list=chop@L2, index=code_block_2.out0)
getItemAtIndex_2 = List.GetItemAtIndex(list=chop@L2, index=code_block_2.out1)
getItemAtIndex_3 = List.GetItemAtIndex(list=chop@L2, index=code_block_2.out2)
byCoordinates = Point.ByCoordinates(x=getItemAtIndex, y=getItemAtIndex_2, z=getItemAtIndex_3)
code_block_3 = CodeBlock { 3; }
chop_2 = List.Chop(list=byCoordinates, lengths=code_block_3)
byPoints = Polygon.ByPoints(points=chop_2)
byPatch = Surface.ByPatch(closedCurve=byPoints)
watch_3 = Watch(byPatch)
