# Dynamo graph Autodesk.DesignScript.Geometry.NurbsCurve.ByPoints(points).dyn "ByPoints" (Dynamo 2.0.1.5055)

code_block = CodeBlock { 3; }
randomList = Math.RandomList(amount=code_block)
sort = List.Sort(list=randomList)
randomList_2 = Math.RandomList(amount=code_block)
sort_2 = List.Sort(list=randomList_2)
byCoordinates = Point.ByCoordinates(x=sort, y=sort_2)
byPoints = NurbsCurve.ByPoints(points=byCoordinates)
