# Dynamo graph Autodesk.DesignScript.Geometry.NurbsCurve.ControlPoints.dyn "ControlPoints" (Dynamo 2.0.1.5055)

code_block = CodeBlock { 9; }
randomList = Math.RandomList(amount=code_block)
formula = Formula("x*20", x=randomList)
sort = List.Sort(list=formula)
randomList_2 = Math.RandomList(amount=code_block)
formula_2 = Formula("y*20", y=randomList_2)
sort_2 = List.Sort(list=formula_2)
byCoordinates = Point.ByCoordinates(x=sort, y=sort_2)
byPoints = NurbsCurve.ByPoints(points=byCoordinates)
controlPoints = NurbsCurve.ControlPoints(nurbsCurve=byPoints)
