# Dynamo graph Autodesk.DesignScript.Geometry.PanelSurface.ByParallelograms.dyn "PanelSurface.ByParallelograms" (Dynamo 3.1.0.3411)

# group: Generate base surface
code_block = CodeBlock { width = 10; length = 20; }
byWidthLength = Rectangle.ByWidthLength(width=code_block.width, length=code_block.length)
byPatch = Surface.ByPatch(closedCurve=byWidthLength)

# group: Create Panels
u_number = DoubleInput(5)
v_number = DoubleInput(10)
# note: Shear Factor between 0 (No shear) and 1 (Full shear)
shear_factor = DoubleInput(0.75)
# note: Boolean that allows you to toggle between U and V axis alignment for the Paralellogram panels
boolean = BoolSelector(true)
byParallelograms = PanelSurface.ByParallelograms(surface=byPatch, numU=u_number, numV=v_number, shearFactor=shear_factor, alignWithUAxis=boolean)

# group: Convert Panels to Surfaces
getPanelPolygon = PanelSurface.GetPanelPolygon(panelSurface=byParallelograms)
