# Dynamo graph Autodesk.DesignScript.Geometry.PanelSurfaceBoundaryCondition.RemoveVertices.dyn "PanelSurfaceBoundaryCondition.RemoveVertices" (Dynamo 3.1.0.3411)

# group: Generate base surface
code_block = CodeBlock { width = 10; length = 20; }
byWidthLength = Rectangle.ByWidthLength(width=code_block.width, length=code_block.length)
byPatch = Surface.ByPatch(closedCurve=byWidthLength)

# group: Create Panels
u_number = DoubleInput(5)
v_number = DoubleInput(10)
removeVertices = PanelSurfaceBoundaryCondition.RemoveVertices()
byHexagons = PanelSurface.ByHexagons(surface=byPatch, numU=u_number, numV=v_number, boundaryCondition=removeVertices)

# group: Convert Panels to Surfaces
getPanelPolygon = PanelSurface.GetPanelPolygon(panelSurface=byHexagons)
