# Dynamo graph Autodesk.DesignScript.Geometry.Plane.ByLineAndPoint.dyn "ByLineAndPoint" (Dynamo 2.0.1.5055)

code_block = CodeBlock { 4; }
randomList = Math.RandomList(amount=code_block)
formula = Formula("x*5", x=randomList)
randomList_2 = Math.RandomList(amount=code_block)
formula_2 = Formula("y*5", y=randomList_2)
randomList_3 = Math.RandomList(amount=code_block)
formula_3 = Formula("z*5", z=randomList_3)
byCoordinates = Point.ByCoordinates(x=formula, y=formula_2, z=formula_3)
byBestFitThroughPoints = Line.ByBestFitThroughPoints(bestFitPoints=byCoordinates)
code_block_2 = CodeBlock { 5; 1; -3; }
byCoordinates_2 = Point.ByCoordinates(x=code_block_2.out0, y=code_block_2.out1, z=code_block_2.out2)
byLineAndPoint = Plane.ByLineAndPoint(line=byBestFitThroughPoints, point=byCoordinates_2)
