# Dynamo graph Autodesk.DesignScript.Geometry.Point.ByCoordinates(x, y).dyn "ByCoordinates" (Dynamo 2.0.1.5055)

grid_bounds_xy = DoubleSlider(61, range=0..100 step 1)  # graph input
grid_spacing = DoubleSlider(2, range=1..5 step 0.1)  # graph input
code_block = CodeBlock(a=grid_bounds_xy, b=grid_spacing) { 0..a..b; }
byCoordinates = Point.ByCoordinates(x=code_block, y=code_block, lacing=CrossProduct)
