# Dynamo graph Autodesk.DesignScript.Geometry.Point.ByCoordinates(x, y, z).dyn "ByCoordinates" (Dynamo 2.0.1.5055)

code_block = CodeBlock { 2; }
code_block_2 = CodeBlock { 3; }
code_block_3 = CodeBlock { 4; }
byCoordinates = Point.ByCoordinates(x=code_block, y=code_block_2, z=code_block_3)
