# Dynamo graph Autodesk.DesignScript.Geometry.Point.ByCylindricalCoordinates.dyn (Dynamo 1.0.1.1167)

origin = Point.Origin()
byOrigin = CoordinateSystem.ByOrigin(origin)
number_slider = DoubleSlider(270, range=0..360 step 30)
number_slider_2 = DoubleSlider(9.1, range=0..10 step 0.1)
code_block = CodeBlock(a=number_slider, b=number_slider_2) { 0..a..10; 0..b..1; }
number_slider_3 = DoubleSlider(3, range=0..10 step 1)
byCylindricalCoordinates = Point.ByCylindricalCoordinates(byOrigin, code_block.out0, code_block.out1, number_slider_3, lacing=CrossProduct)
