# Dynamo graph Autodesk.DesignScript.Geometry.Point.BySphericalCoordinates.dyn (Dynamo 2.17.0.3255)

code_block = CodeBlock { 1; 5; 1; }
byCoordinates = Point.ByCoordinates(x=code_block.out0, y=code_block.out1, z=code_block.out2)
byOrigin = CoordinateSystem.ByOrigin(origin=byCoordinates)
number_slider = DoubleSlider(210, range=0..360 step 30)  # graph input
number_slider_2 = DoubleSlider(150, range=0..180 step 10)  # graph input
code_block_2 = CodeBlock(a=number_slider, b=number_slider_2) { 0..a..10; 0..b..10; }
number_slider_3 = DoubleSlider(8, range=0..10 step 1)  # graph input
bySphericalCoordinates = Point.BySphericalCoordinates(coordinateSystem=byOrigin, phi=code_block_2.out0, theta=code_block_2.out1, radius=number_slider_3, lacing=CrossProduct)
