# Dynamo graph Autodesk.DesignScript.Geometry.PolyCurve.ExtendWithEllipse.dyn "ExtendWithEllipse" (Dynamo 2.0.1.5055)

code_block = CodeBlock { pt1 = Point.ByCoordinates(4,2); pt2 = Point.ByCoordinates(-3,4); [pt1, pt2]; }
byPoints = PolyCurve.ByPoints(points=code_block.out2)
length = DoubleSlider(17.7, range=0.1..100 step 0.1)  # graph input
radius_1 = DoubleSlider(8.7, range=0.1..100 step 0.1)  # graph input
radius_2 = DoubleSlider(1.8, range=0.1..100 step 0.1)  # graph input
code_block_2 = CodeBlock { 1; }
boolean = BoolSelector(true)  # graph input
extendWithEllipse = PolyCurve.ExtendWithEllipse(polyCurve=byPoints, length=length, radius1=radius_1, radius2=radius_2, endEllipseParameter=code_block_2, endOrStart=boolean)
