# Dynamo graph Autodesk.DesignScript.Geometry.PolyCurve.Offset.dyn "Offset" (Dynamo 2.0.1.5055)

integer_slider = IntegerSlider(3, range=0..20 step 1)  # graph input
randomList = Math.RandomList(amount=integer_slider)
code_block = CodeBlock(x=randomList) { x*10; }
randomList_2 = Math.RandomList(amount=integer_slider)
code_block_2 = CodeBlock(x=randomList_2) { x*10; }
byCoordinates = Point.ByCoordinates(x=code_block, y=code_block_2)
boolean = BoolSelector(false)  # graph input
byPoints = PolyCurve.ByPoints(points=byCoordinates, connectLastToFirst=boolean)
number_slider = DoubleSlider(3.5, range=0..20 step 0.1)  # graph input
boolean_2 = BoolSelector(true)  # graph input
offset = PolyCurve.Offset(polyCurve=byPoints, signedDistance=number_slider, extendCircular=boolean_2)
