# Dynamo graph Autodesk.DesignScript.Geometry.PolySurface.ExtractSolids.dyn "ExtractSolids" (Dynamo 2.0.1.5055)

origin = Point.Origin()
byCenterPointRadius = Circle.ByCenterPointRadius(centerPoint=origin)
code_block = CodeBlock { 5; }
byCoordinates = Point.ByCoordinates(z=code_block)
code_block_2 = CodeBlock { 2; }
byCenterPointRadius_2 = Circle.ByCenterPointRadius(centerPoint=byCoordinates, radius=code_block_2)
create = List.Create(item0=byCenterPointRadius, item1=byCenterPointRadius_2)
byLoft = PolySurface.ByLoft(crossSections=create)
extractSolids = PolySurface.ExtractSolids(polySurface=byLoft)
