# Dynamo graph Autodesk.DesignScript.Geometry.Polygon.Points.dyn (Dynamo 2.17.0.3255)

number_slider = DoubleSlider(7, range=3..10 step 1)  # graph input
randomList = Math.RandomList(amount=number_slider)
sort = List.Sort(list=randomList)
code_block = CodeBlock(x=sort) { x*360; }
randomList_2 = Math.RandomList(amount=number_slider)
code_block_2 = CodeBlock(x=randomList_2) { x*5; }
byCylindricalCoordinates = Point.ByCylindricalCoordinates(angle=code_block, radius=code_block_2)
byPoints = Polygon.ByPoints(points=byCylindricalCoordinates)
points = PolyCurve.Points(polyCurve=byPoints)
