# Dynamo graph Autodesk.DesignScript.Geometry.Solid.ByJoinedSurfaces.dyn "ByJoinedSurfaces" (Dynamo 2.0.1.5055)

byCenterPointRadius = Circle.ByCenterPointRadius()
byPatch = Surface.ByPatch(closedCurve=byCenterPointRadius)
number_slider = DoubleSlider(2.1, range=0..10 step 0.1)  # graph input
extrude = Curve.Extrude(curve=byCenterPointRadius, distance=number_slider)
translate = Geometry.Translate(geometry=byPatch, zTranslation=number_slider)
create = List.Create(item0=byPatch, item1=extrude, item2=translate)
byJoinedSurfaces = Solid.ByJoinedSurfaces(facesOfSolid=create)
