# Dynamo graph Autodesk.DesignScript.Geometry.Solid.Difference.dyn "Difference" (Dynamo 2.0.1.5055)

number_slider = DoubleSlider(6.041, range=0..100 step 0.1)
byCoordinates = Point.ByCoordinates(z=number_slider)
code_block = CodeBlock { 10; }
byLengths = Cuboid.ByLengths(origin=byCoordinates, width=code_block, length=code_block, height=code_block)
number_slider_2 = DoubleSlider(11.523, range=0..100 step 0.1)
byCoordinates_2 = Point.ByCoordinates(z=number_slider_2)
code_block_2 = CodeBlock { 5; }
byCenterPointRadius = Sphere.ByCenterPointRadius(centerPoint=byCoordinates_2, radius=code_block_2)
difference = Solid.Difference(solid=byLengths, other=byCenterPointRadius)
