# Dynamo graph Autodesk.DesignScript.Geometry.Solid.DifferenceAll.dyn "DifferenceAll" (Dynamo 2.0.1.5055)

number_slider = DoubleSlider(6.041, range=0..100 step 0.1)
byCoordinates = Point.ByCoordinates(z=number_slider)
code_block = CodeBlock { 10; }
byLengths = Cuboid.ByLengths(origin=byCoordinates, width=code_block, length=code_block, height=code_block)
code_block_2 = CodeBlock { 0..12..#10; }
byCoordinates_2 = Point.ByCoordinates(z=code_block_2, lacing=CrossProduct)
code_block_3 = CodeBlock { 5; }
byCenterPointRadius = Sphere.ByCenterPointRadius(centerPoint=byCoordinates_2, radius=code_block_3)
differenceAll = Solid.DifferenceAll(solid=byLengths, others=byCenterPointRadius)
