# Dynamo graph Autodesk.DesignScript.Geometry.Solid.Volume.dyn "Volume" (Dynamo 2.0.1.5055)

byLengths = Cuboid.ByLengths()
faces = Topology.Faces(topology=byLengths)
edges = Face.Edges(face=faces)
code_block = CodeBlock { 0; }
getItemAtIndex = List.GetItemAtIndex(list=edges, index=code_block)
number_slider = DoubleSlider(0.23, range=0..0.5 step 0.01)  # graph input
chamfer = Solid.Chamfer(solid=byLengths, edges=getItemAtIndex, offset=number_slider)
volume = Solid.Volume(solid=chamfer)
