# Dynamo graph Autodesk.DesignScript.Geometry.Sphere.ByCenterPointRadius.dyn "ByCenterPointRadius" (Dynamo 2.0.1.5055)

code_block = CodeBlock { 4; 2; -5; }
byCoordinates = Point.ByCoordinates(x=code_block.out0, y=code_block.out1, z=code_block.out2)
number_slider = DoubleSlider(5.5, range=0..100 step 0.1)  # graph input
byCenterPointRadius = Sphere.ByCenterPointRadius(centerPoint=byCoordinates, radius=number_slider)
