# Dynamo graph Autodesk.DesignScript.Geometry.Surface.ByRuledLoft.dyn "ByRuledLoft" (Dynamo 2.0.1.5055)

code_block = CodeBlock { Point.ByCoordinates(0, 0, 0); Point.ByCoordinates(10, 0, 0); }
byStartPointEndPoint = Line.ByStartPointEndPoint(startPoint=code_block.out0, endPoint=code_block.out1)
code_block_2 = CodeBlock { 0..10..1; }
code_block_3 = CodeBlock { 0..360..36; }
sin = Math.Sin(angle=code_block_3)
translate = Geometry.Translate(geometry=byStartPointEndPoint, yTranslation=code_block_2, zTranslation=sin)
byRuledLoft = Surface.ByRuledLoft(crossSections=translate)
