# Dynamo graph Autodesk.DesignScript.Geometry.Surface.Closed.dyn "Closed" (Dynamo 2.0.1.5055)

code_block = CodeBlock { 5; }
byCenterPointRadius = Circle.ByCenterPointRadius(radius=code_block)
code_block_2 = CodeBlock { 3; }
extrude = Curve.Extrude(curve=byCenterPointRadius, distance=code_block_2)
closed = Surface.Closed(surface=extrude)
watch = Watch(closed)
number_slider = DoubleSlider(322.2, range=0..360 step 0.1)  # graph input
code_block_3 = CodeBlock(angle=number_slider) { cPoint = Point.ByCoordinates(15,0,0); radius = 5; sAngle = 0; eAngle = angle; normal = Vector.ZAxis(); distance = 3; }
byCenterPointRadiusAngle = Arc.ByCenterPointRadiusAngle(center=code_block_3.cPoint, radius=code_block_3.radius, startAngle=code_block_3.sAngle, endAngle=code_block_3.eAngle, normal=code_block_3.normal)
code_block_4 = CodeBlock { 3; }
extrude_2 = Curve.Extrude(curve=byCenterPointRadiusAngle, distance=code_block_4)
closed_2 = Surface.Closed(surface=extrude_2)
watch_2 = Watch(closed_2)
