# Dynamo graph Autodesk.DesignScript.Geometry.Surface.Difference.dyn "Surface.Difference" (Dynamo 2.14.0.3835)

code_block = CodeBlock { 10; }
byWidthLength = Rectangle.ByWidthLength(width=code_block, length=code_block)
byPatch = Surface.ByPatch(closedCurve=byWidthLength)
byCenterPointRadius = Circle.ByCenterPointRadius()
byPatch_2 = Surface.ByPatch(closedCurve=byCenterPointRadius)
difference = Surface.Difference(surface=byPatch, others=byPatch_2)
watch_3d = Watch3D(difference)
