# Dynamo graph Autodesk.DesignScript.Geometry.TSpline.TSplineInitialSymmetry.XAxis.dyn (Dynamo 2.12.0.5650)

number_slider = DoubleSlider(35, range=0..100 step 1)
number_slider_2 = DoubleSlider(35, range=0..100 step 1)
number_slider_3 = DoubleSlider(10, range=0..100 step 1)
byCoordinates = Point.ByCoordinates(x=number_slider, y=number_slider_2, z=number_slider_3)
code_block = CodeBlock { 6; }
code_block_2 = CodeBlock { 6; }
code_block_3 = CodeBlock { 3; }
boolean = BoolSelector(true)
boolean_2 = BoolSelector(true)
boolean_3 = BoolSelector(false)
byAxial = TSpline.TSplineInitialSymmetry.ByAxial(xAxis=boolean, yAxis=boolean_2, zAxis=boolean_3)
boolean_4 = BoolSelector(true)
byBoxCorners = TSpline.TSplineSurface.ByBoxCorners(highPoint=byCoordinates, xSpans=code_block, ySpans=code_block_2, zSpans=code_block_3, symmetry=byAxial, inSmoothMode=boolean_4)
regularFaces = TSpline.TSplineTopology.RegularFaces(tSplineTopology=byBoxCorners)
number_slider_4 = DoubleSlider(36, range=0..220 step 1)
getItemAtIndex = List.GetItemAtIndex(list=regularFaces, index=number_slider_4)
integer_slider = IntegerSlider(-7, range=-20..20 step 1)
integer_slider_2 = IntegerSlider(-4, range=-20..20 step 1)
integer_slider_3 = IntegerSlider(-10, range=-20..20 step 1)
byCoordinates_2 = Vector.ByCoordinates(x=integer_slider, y=integer_slider_2, z=integer_slider_3)
code_block_4 = CodeBlock { 6; }
extrudeFaces = TSpline.TSplineSurface.ExtrudeFaces(tSplineSurface=byBoxCorners, faces=getItemAtIndex, direction=byCoordinates_2, spans=code_block_4)
XAxis = TSpline.TSplineInitialSymmetry.XAxis(tSplineInitialSymmetry=byAxial)
watch = Watch(XAxis)
