# Dynamo graph Autodesk.DesignScript.Geometry.TSpline.TSplineReflection.Axis.dyn "Autodesk.DesignScript.Geometry.TSpline.TSplineReflection.Axisdyn" (Dynamo 2.19.3.6543)

code_block = CodeBlock { 5; }
byOrigin = CoordinateSystem.ByOrigin(z=code_block)
code_block_2 = CodeBlock { 4; }
code_block_3 = CodeBlock { 1.5; 5; }
code_block_4 = CodeBlock { 6; }
boolean = BoolSelector(true)
byConeCoordinateSystemHeightRadii = TSpline.TSplineSurface.ByConeCoordinateSystemHeightRadii(cs=byOrigin, height=code_block_2, startRadius=code_block_3.out0, endRadius=code_block_3.out1, radiusSpans=code_block_4, heightSpans=code_block_4, inSmoothMode=boolean)
byCoordinates = Point.ByCoordinates(z=code_block)
byOriginNormal = Plane.ByOriginNormal(origin=byCoordinates)
byAxial = TSpline.TSplineReflection.ByAxial(plane=byOriginNormal)
boolean_2 = BoolSelector(true)
code_block_5 = CodeBlock { 1; }
addReflections = TSpline.TSplineSurface.AddReflections(tSplineSurface=byConeCoordinateSystemHeightRadii, reflections=byAxial, weldSymmetricPortions=boolean_2, weldTolerance=code_block_5)
reflections = TSpline.TSplineSurface.Reflections(tSplineSurface=addReflections)
axis = TSpline.TSplineReflection.Axis(tSplineReflection=reflections)
