# Dynamo graph Autodesk.DesignScript.Geometry.TSpline.TSplineSurface.BevelEdges.dyn (Dynamo 2.19.3.6543)

code_block = CodeBlock { 15; }
code_block_2 = CodeBlock { 3; }
boolean = BoolSelector(true)
byBoxLengths = TSpline.TSplineSurface.ByBoxLengths(width=code_block, length=code_block, height=code_block, xSpans=code_block_2, ySpans=code_block_2, zSpans=code_block_2, inSmoothMode=boolean)
code_block_3 = CodeBlock { [9,43,67]; }
edgeByIndex = TSpline.TSplineTopology.EdgeByIndex(tSplineTopology=byBoxLengths, index=code_block_3)
percentage = DoubleSlider(0.5, range=0.05..0.95 step 0.05)
number_of_segments = IntegerSlider(1, range=1..10 step 1)
boolean_2 = BoolSelector(false)
roundness = DoubleSlider(0.5, range=0.05..0.95 step 0.05)
bevelEdges = TSpline.TSplineSurface.BevelEdges(tSplineSurface=byBoxLengths, edges=edgeByIndex, percentage=percentage, segments=number_of_segments, keepOnFace=boolean_2, roundness=roundness)
