# Dynamo graph Autodesk.DesignScript.Geometry.TSpline.TSplineSurface.BySphereBestFit.dyn (Dynamo 2.19.3.6543)

boolean = BoolSelector(true)
boolean_2 = BoolSelector(true)
boolean_3 = BoolSelector(true)
byAxial = TSpline.TSplineInitialSymmetry.ByAxial(xAxis=boolean, yAxis=boolean_2, zAxis=boolean_3)

# group: Randomly generated list of points
code_block = CodeBlock { 15; }
code_block_2 = CodeBlock(n=code_block) { n*3; }
randomList = Math.RandomList(amount=code_block_2)
code_block_3 = CodeBlock { 25; }
remapRange = Math.RemapRange(numbers=randomList, newMax=code_block_3)
code_block_4 = CodeBlock { 3; }
chop = List.Chop(list=remapRange, lengths=code_block_4)
transpose = List.Transpose(lists=chop)
code_block_5 = CodeBlock(x=transpose) { x[0]; x[1]; x[2]; }
byCoordinates = Point.ByCoordinates(x=code_block_5.out0, y=code_block_5.out1, z=code_block_5.out2)

code_block_6 = CodeBlock { 12; 10; }
boolean_4 = BoolSelector(true)
bySphereBestFit = TSpline.TSplineSurface.BySphereBestFit(points=byCoordinates, radiusSpans=code_block_6.out0, heightSpans=code_block_6.out1, inSmoothMode=boolean_4)
