# Dynamo graph Autodesk.DesignScript.Geometry.TSpline.TSplineSurface.CreaseEdges.dyn (Dynamo 2.19.3.6543)

code_block = CodeBlock { 5; 10; }
code_block_2 = CodeBlock { 5; 8; }
boolean = BoolSelector(true)
byTorusCenterRadii = TSpline.TSplineSurface.ByTorusCenterRadii(innerRadius=code_block.out0, outerRadius=code_block.out1, innerRadiusSpans=code_block_2.out0, outerRadiusSpans=code_block_2.out1, inSmoothMode=boolean)
code_block_3 = CodeBlock { 3; }
edgeByIndex = TSpline.TSplineTopology.EdgeByIndex(tSplineTopology=byTorusCenterRadii, index=code_block_3)
creaseEdges = TSpline.TSplineSurface.CreaseEdges(tSplineSurface=byTorusCenterRadii, edges=edgeByIndex)
UVNFrame = TSpline.TSplineEdge.UVNFrame(tSplineEdge=edgeByIndex)
position = TSpline.TSplineUVNFrame.Position(tSplineUVNFrame=UVNFrame)
