# Dynamo graph Autodesk.DesignScript.Geometry.TSpline.TSplineSurface.FillHole.dyn (Dynamo 2.19.3.6543)

code_block = CodeBlock { 4; 4; 0; }
byOrigin = CoordinateSystem.ByOrigin(x=code_block.out0, y=code_block.out1, z=code_block.out2)
code_block_2 = CodeBlock { 4; 8; }
code_block_3 = CodeBlock { 10; 4; }
boolean = BoolSelector(true)
byCylinderRadiusHeight = TSpline.TSplineSurface.ByCylinderRadiusHeight(cs=byOrigin, radius=code_block_2.out0, height=code_block_2.out1, radiusSpans=code_block_3.out0, heightSpans=code_block_3.out1, inSmoothMode=boolean)
edges = Topology.Edges(topology=byCylinderRadiusHeight)
code_block_4 = CodeBlock { 40..49; }
getItemAtIndex = List.GetItemAtIndex(list=edges, index=code_block_4)
integer_slider = IntegerSlider(3, range=0..3 step 1)
boolean_2 = BoolSelector(false)  # graph input
fillHole = TSpline.TSplineSurface.FillHole(tSplineSurface=byCylinderRadiusHeight, edges=getItemAtIndex, fillMethod=integer_slider, keepSubdCreases=boolean_2)
UVNFrame = TSpline.TSplineEdge.UVNFrame(tSplineEdge=getItemAtIndex)
position = TSpline.TSplineUVNFrame.Position(tSplineUVNFrame=UVNFrame)
