# Dynamo graph Autodesk.DesignScript.Geometry.TSpline.TSplineSurface.IsClosed.dyn (Dynamo 2.13.1.3887)

code_block = CodeBlock { 5; }
boolean = BoolSelector(true)
bySphereCenterPointRadius = TSpline.TSplineSurface.BySphereCenterPointRadius(radius=code_block, inSmoothMode=boolean)
borderEdges = TSpline.TSplineTopology.BorderEdges(tSplineTopology=bySphereCenterPointRadius)
fillHole = TSpline.TSplineSurface.FillHole(tSplineSurface=bySphereCenterPointRadius, edges=borderEdges)
code_block_2 = CodeBlock { 15; }
translate = Geometry.Translate(geometry=fillHole, xTranslation=code_block_2)
isClosed = TSpline.TSplineSurface.IsClosed(tSplineSurface=fillHole)
watch = Watch(isClosed)
isClosed_2 = TSpline.TSplineSurface.IsClosed(tSplineSurface=bySphereCenterPointRadius)
watch_2 = Watch(isClosed_2)
