# Dynamo graph Autodesk.DesignScript.Geometry.TSpline.TSplineSurface.ToBRep.dyn (Dynamo 2.19.3.6543)

number_slider = DoubleSlider(36.084, range=-2.816..100 step 0.1)
number_slider_2 = DoubleSlider(35.093, range=-14.607..148.143 step 0.1)
number_slider_3 = DoubleSlider(37.8, range=0..100 step 0.1)
byCoordinates = Point.ByCoordinates(x=number_slider, y=number_slider_2, z=number_slider_3)
code_block = CodeBlock { 5; }
code_block_2 = CodeBlock { 5; }
code_block_3 = CodeBlock { 3; }
boolean = BoolSelector(true)
byBoxCorners = TSpline.TSplineSurface.ByBoxCorners(highPoint=byCoordinates, xSpans=code_block, ySpans=code_block_2, zSpans=code_block_3, inSmoothMode=boolean)
boolean_2 = BoolSelector(true)
toBRep = TSpline.TSplineSurface.ToBRep(tSplineSurface=byBoxCorners, matchTopology=boolean_2)
explode = Geometry.Explode(geometry=toBRep)
code_block_4 = CodeBlock { 15..30; }
getItemAtIndex = List.GetItemAtIndex(list=explode, index=code_block_4)
code_block_5 = CodeBlock { 40; }
translate = Geometry.Translate(geometry=getItemAtIndex, xTranslation=code_block_5)
watch = Watch(toBRep)
