# Dynamo graph Autodesk.DesignScript.Geometry.TSpline.TSplineVertex.Index.dyn (Dynamo 3.0.0.5795)

number_slider = DoubleSlider(60, range=-2.816..100 step 0.1)
number_slider_2 = DoubleSlider(20, range=-14.607..148.143 step 0.1)
number_slider_3 = DoubleSlider(15, range=0..100 step 0.1)
byCoordinates = Point.ByCoordinates(x=number_slider, y=number_slider_2, z=number_slider_3)
code_block = CodeBlock { 5; 3; 3; }
boolean = BoolSelector(true)
byBoxCorners = TSpline.TSplineSurface.ByBoxCorners(highPoint=byCoordinates, xSpans=code_block.out0, ySpans=code_block.out1, zSpans=code_block.out2, inSmoothMode=boolean)
starPointVertices = TSpline.TSplineTopology.StarPointVertices(tSplineTopology=byBoxCorners)
index = TSpline.TSplineVertex.Index(tSplineVertex=starPointVertices)
watch = Watch(index)
vertexByIndex = TSpline.TSplineTopology.VertexByIndex(tSplineTopology=byBoxCorners, index=index)
deleteVertices = TSpline.TSplineSurface.DeleteVertices(tSplineSurface=byBoxCorners, vertices=vertexByIndex)
