# Dynamo graph Autodesk.DesignScript.Geometry.TSpline.TSplineVertex.IsTPoint.dyn (Dynamo 3.0.0.5795)

code_block = CodeBlock { 70; 20; 15; }
byCoordinates = Point.ByCoordinates(x=code_block.out0, y=code_block.out1, z=code_block.out2)
code_block_2 = CodeBlock { 5; 3; 3; }
boolean = BoolSelector(true)
byBoxCorners = TSpline.TSplineSurface.ByBoxCorners(highPoint=byCoordinates, xSpans=code_block_2.out0, ySpans=code_block_2.out1, zSpans=code_block_2.out2, inSmoothMode=boolean)
number_slider = DoubleSlider(37, range=0..50 step 1)
faceByIndex = TSpline.TSplineTopology.FaceByIndex(tSplineTopology=byBoxCorners, index=number_slider)
boolean_2 = BoolSelector(false)
subdivideFaces = TSpline.TSplineSurface.SubdivideFaces(tSplineSurface=byBoxCorners, faces=faceByIndex, exact=boolean_2)

# group: Visualize the position of T-Points
TPointVertices = TSpline.TSplineTopology.TPointVertices(tSplineTopology=subdivideFaces)
UVNFrame = TSpline.TSplineVertex.UVNFrame(tSplineVertex=TPointVertices)
position = TSpline.TSplineUVNFrame.Position(tSplineUVNFrame=UVNFrame)

code_block_3 = CodeBlock { 80; }
vertexByIndex = TSpline.TSplineTopology.VertexByIndex(tSplineTopology=subdivideFaces, index=code_block_3)
isTPoint = TSpline.TSplineVertex.IsTPoint(tSplineVertex=vertexByIndex)
watch = Watch(isTPoint)
