# Dynamo graph Autodesk.DesignScript.Geometry.Vector.Rotate(plane, degrees).dyn "Rotate" (Dynamo 2.0.1.5055)

origin = Point.Origin()
code_block = CodeBlock { 1; }
byCoordinates = Vector.ByCoordinates(x=code_block, y=code_block, z=code_block)
XZ = Plane.XZ()
number_slider = DoubleSlider(54.6, range=0..90 step 0.1)  # graph input
rotate = Vector.Rotate(vector=byCoordinates, plane=XZ, degrees=number_slider)
code_block_2 = CodeBlock { 4; }
byStartPointDirectionLength = Line.ByStartPointDirectionLength(startPoint=origin, direction=rotate, length=code_block_2)
XY = Plane.XY()
YZ = Plane.YZ()
