# Dynamo graph Autodesk.DesignScript.Geometry.Vector.Z.dyn "Z" (Dynamo 2.0.1.5055)

code_block = CodeBlock { Point.ByCoordinates(0,2,0); Vector.ByCoordinates(4,2,3); }
vector_scale = DoubleSlider(1.65, range=1..2 step 0.01)  # graph input
scale = Vector.Scale(vector=code_block.out1, scale_factor=vector_scale)
length = Vector.Length(vector=scale)
byStartPointDirectionLength = Line.ByStartPointDirectionLength(startPoint=code_block.out0, direction=code_block.out1, length=length)
Z = Vector.Z(vector=code_block.out1)
watch = Watch(Z)
Z_2 = Vector.Z(vector=scale)
watch_2 = Watch(Z_2)
code_block_2 = CodeBlock {  }
