# Dynamo graph CoreNodeModels.ColorRange.dyn "CoreNodeModels.ColorRange_img" (Dynamo 3.0.0.6432)

code_block = CodeBlock { 0..50..#10; }
byCoordinates = Point.ByCoordinates(x=code_block, y=code_block, lacing=CrossProduct)
code_block_2 = CodeBlock { 5; }
byLengths = Cuboid.ByLengths(origin=byCoordinates, width=code_block_2, length=code_block_2, height=code_block_2)
color_palette = ColorPalette({R: 220, G: 20, B: 60, A: 255})
color_palette_2 = ColorPalette({R: 100, G: 149, B: 237, A: 255})
list_create = List.Create(item0=color_palette, item1=color_palette_2)
code_block_3 = CodeBlock { 0..1; }
code_block_4 = CodeBlock { 0..1..#10; }
color_range = ColorRange(colors=list_create, indices=code_block_3, value=code_block_4)
byGeometryColor = Modifiers.GeometryColor.ByGeometryColor(geometry=byLengths, color=color_range)
