# Dynamo graph CoreNodeModels.DefineData.dyn "DataInput" (Dynamo 3.1.0.3411)

code_block = CodeBlock { "The quick brown fox jumps over the lazy dog"; 1; 21.1; false; Point.ByCoordinates(0,0,0); [1,2,3,4,5]; }

# group: Automatic validation is locked
# when in this mode, the node only accepts valid data.
defineData = DefineData("Number", code_block.out0, IsAutoMode=false, IsList=false, DisplayValue="Number")
defineData_2 = DefineData("Number", code_block.out2, IsAutoMode=false, IsList=false, DisplayValue="Number")

# group: Automatic validation is unlocked
# The node will automatically set the matching data type.
defineData_3 = DefineData("Integer", code_block.out5, IsAutoMode=true, IsList=true, DisplayValue="Integer")
