# Dynamo graph CoreNodeModels.Formula.dyn "CoreNodeModels.Formula_img" (Dynamo 2.17.0.3255)

code_block = CodeBlock { 0..26; }
number_slider = DoubleSlider(12.3, range=0..100 step 0.1)
formula = Formula("if(x % 4 = 3, y, 2)", x=code_block, y=number_slider)
watch = Watch(formula)
code_block_2 = CodeBlock { 0..26; }
byCoordinates = Point.ByCoordinates(x=watch, y=code_block_2)
byControlPoints = NurbsCurve.ByControlPoints(points=byCoordinates)
