# Dynamo graph CoreNodeModels.FromObject.dyn "CoreNodeModels.FromObject_img" (Dynamo 2.17.0.3255)

byLengths = Cuboid.ByLengths()
string_from_object = FromObject(object=byLengths)
type = Object.Type(object=string_from_object)
