# Dynamo graph CoreNodeModels.HigherOrder.CartesianProduct.dyn "CartesianProduct" (Dynamo 2.0.2.6826)

add = _ + _  # unwired: x, y
code_block = CodeBlock { 1..5; }
cartesianProduct = List.CartesianProduct(comb=add, list1=code_block, list2=code_block)
