# Dynamo graph CoreNodeModels.HigherOrder.ComposeFunctions.dyn (Dynamo 1.1.0.2093)

code_block = CodeBlock { 0..20; }
byCoordinates = Point.ByCoordinates(x=code_block)
code_block_2 = CodeBlock { 7; }
mod = _ % code_block_2
code_block_3 = CodeBlock { 3; }
div = _ / code_block_3
compose = ComposeFunctions(mod, div)  # "Function.Compose"
apply = ApplyFunction(compose, code_block)  # "Function.Apply"
watch = Watch(apply)
code_block_4 = CodeBlock { 1; }
add = watch + code_block_4
byCenterPointRadiusNormal = Circle.ByCenterPointRadiusNormal(byCoordinates, add)
formula = Formula("a+b+c")
