# Dynamo graph CoreNodeModels.HigherOrder.Filter.dyn (Dynamo 2.17.0.3255)

code_block = CodeBlock { 1..5; }
code_block_2 = CodeBlock { 1; }
eq = _ == code_block_2  # unwired: x
filter = List.Filter(list=code_block, condition=eq)
watch = Watch(filter.in)
watch_2 = Watch(filter.out)
