# Dynamo graph CoreNodeModels.HigherOrder.LaceLongest.dyn "LaceLongest" (Dynamo 2.0.2.6826)

list_create = List.Create()  # unwired: item0, item1
code_block = CodeBlock { 1..5; }
code_block_2 = CodeBlock { 2..10..#5; }
laceLongest = List.LaceLongest(comb=list_create, list1=code_block, list2=code_block_2)
