# Dynamo graph CoreNodeModels.HigherOrder.Map.dyn (Dynamo 2.17.0.3255)

code_block = CodeBlock { [1..5]; }
code_block_2 = CodeBlock { 1; }
add = _ + code_block_2  # unwired: x
map = List.Map(list=code_block, f_x=add)
