# Dynamo graph CoreNodeModels.HigherOrder.Replace.dyn "CoreNodeModels.HigherOrder.Replace_img" (Dynamo 2.17.0.3255)

code_block = CodeBlock { 0..5..1; }
watch = Watch(code_block)
code_block_2 = CodeBlock { 10; }
formula = Formula("x%2==0")  # unwired: x
replaceByCondition = Replace(item=watch, replaceWith=code_block_2, condition=formula)
watch_2 = Watch(replaceByCondition)
