# Dynamo graph CoreNodeModels.Input.FileObject.dyn "CoreNodeModels.Input.FileObject_img" (Dynamo 2.17.0.3255)

file_path = Filename("..\..\..\..\..\..\..\..\..\..\Temp\sample.csv")
file_from_path = FileObject(path=file_path)
watch = Watch(file_from_path)
