# Dynamo graph CoreNodeModels.Logic.Or.dyn "Or" (Dynamo 2.0.1.5055)

boolean = BoolSelector(false)  # graph input
boolean_2 = BoolSelector(true)  # graph input
boolean_3 = BoolSelector(false)  # graph input
or_ = Or(bool0=boolean, bool1=boolean_2, bool2=boolean_3)
watch = Watch(or_)
