# Dynamo graph CoreNodeModels.Logic.ScopedIf.dyn "CoreNodeModels.Logic.ScopedIf_img" (Dynamo 2.17.0.3255)

boolean = BoolSelector(false)
code_block = CodeBlock { 0..20..2; 0..5..1; }
scopeIf = ScopedIf(test=boolean, true=code_block.out0, false=code_block.out1)
watch = Watch(scopeIf)
byCoordinates = Point.ByCoordinates(x=watch, y=watch)
