# Dynamo graph CoreNodeModelsWpf.Charts.BasicLineChartNodeModel.dyn "Index-Value Line Plot" (Dynamo 2.18.0.3514)

code_block = CodeBlock { ["2019","2020","2021"]; [[2,53,14,45,6],[22,41,45,61,21],[34,51,34,65,2]]; }
color_palette = ColorPalette({R: 106, G: 192, B: 231, A: 255})
color_palette_2 = ColorPalette({R: 235, G: 85, B: 85, A: 255})
color_palette_3 = ColorPalette({R: 251, G: 181, B: 73, A: 255})
list_create = List.Create(item0=color_palette, item1=color_palette_2, item2=color_palette_3)
index_value_line_plot = BasicLineChartNodeModel(labels=code_block.out0, values=code_block.out1, colors=list_create, Labels=["2019", "2020", "2021"], Values=[[2, 53, 14, 45, 6], [22, 41, 45, 61, 21], [34, 51, 34, 65, 2]], Colors=["#FF6AC0E7", "#FFEB5555", "#FFFBB549"])
