# Dynamo graph CoreNodeModelsWpf.Charts.HeatSeriesNodeModel.dyn "Heat Series Plot" (Dynamo 2.18.0.3514)

code_block = CodeBlock()
# ---------- code_block.designscript (3 lines) ----------
["Item 1","Item 2","Item 3","Item 4","Item 5","Item 6"];
["January","February","March","April","May","June"];
[[1,2,3,4,2,1],[-12,12,4,-61,45,88],[4,4,5,5,16,-6],[-74,37,83,-262,54,44],[232,133,444,323,414,231],[332,122,98,89,89,78]];
# ----------------------------------------
color_palette = ColorPalette({R: 106, G: 192, B: 231, A: 255})
color_palette_2 = ColorPalette({R: 235, G: 85, B: 85, A: 255})
list_create = List.Create(item0=color_palette, item1=color_palette_2)
heat_series_plot = HeatSeriesNodeModel(x_labels=code_block.out0, y_labels=code_block.out1, values=code_block.out2, colors=list_create, XLabels=["Item 1", "Item 2", "Item 3", "Item 4", "Item 5", "Item 6"], YLabels=["January", "February", "March", "April", "May", "June"], Values=[[1, 2, 3, 4, 2, 1], [-12, 12, 4, -61, 45, 88], [4, 4, 5, 5, 16, -6], [-74, 37, 83, -262, 54, 44], [232, 133, 444, 323, 414, 231], [332, 122, 98, 89, 89, 78]], Colors=["#FF6AC0E7", "#FFEB5555"])
