# Dynamo graph CoreNodeModelsWpf.Charts.ScatterPlot.dyn "Scatter Plot" (Dynamo 2.18.0.3514)

code_block = CodeBlock { ["2019","2020","2021"]; [[70,20,10],[12,24,44],[35,5,16]]; [[30,50,40],[60,40,-13],[62,-3,28]]; }
color_palette = ColorPalette({R: 106, G: 192, B: 231, A: 255})
color_palette_2 = ColorPalette({R: 235, G: 85, B: 85, A: 255})
color_palette_3 = ColorPalette({R: 251, G: 181, B: 73, A: 255})
list_create = List.Create(item0=color_palette, item1=color_palette_2, item2=color_palette_3)
scatter_plot = ScatterPlotNodeModel(labels=code_block.out0, x_values=code_block.out1, y_values=code_block.out2, colors=list_create, Labels=["2019", "2020", "2021"], XValues=[[70, 20, 10], [12, 24, 44], [35, 5, 16]], YValues=[[30, 50, 40], [60, 40, -13], [62, -3, 28]], Colors=["#FF6AC0E7", "#FFEB5555", "#FFFBB549"])
