# Dynamo graph DSCore.Color.Add.dyn "Add" (Dynamo 2.0.1.5055)

byLengths = Cuboid.ByLengths()
number_slider = DoubleSlider(84, range=0..255 step 1)  # graph input
number_slider_2 = DoubleSlider(255, range=0..255 step 1)  # graph input
byARGB = Color.ByARGB(a=number_slider, r=number_slider_2)
number_slider_3 = DoubleSlider(116, range=0..255 step 1)  # graph input
number_slider_4 = DoubleSlider(255, range=0..255 step 1)  # graph input
byARGB_2 = Color.ByARGB(a=number_slider_3, g=number_slider_4)
add = Color.Add(c1=byARGB, c2=byARGB_2)
byGeometryColor = Modifiers.GeometryColor.ByGeometryColor(geometry=byLengths, color=add)
