# Dynamo graph DSCore.DateTime.DaysInMonth.dyn "DaysInMonth" (Dynamo 2.0.1.5055)

code_block = CodeBlock { 2006; }
code_block_2 = CodeBlock { 8; }
daysInMonth = DateTime.DaysInMonth(year=code_block, month=code_block_2)
watch = Watch(daysInMonth)
