# Dynamo graph DSCore.IO.FileSystem.DeleteDirectory.dyn "DSCore.IO.FileSystem.DeleteDirectory_img" (Dynamo 2.17.0.3255)

directory_path = Directory("C:\Temp\NewFolder2")
boolean = BoolSelector(true)
deleteDirectory = FileSystem.DeleteDirectory(path=directory_path, recursive=boolean)
