# Dynamo graph DSCore.IO.FileSystem.FileExists.dyn "DSCore.IO.FileSystem.FileExists_img" (Dynamo 2.17.0.3255)

file_path = Filename("..\..\..\..\..\..\..\..\..\..\Temp\Sample.txt")
deleteFile = FileSystem.DeleteFile(path=file_path)
fileExists = FileSystem.FileExists(path=file_path)
watch = Watch(fileExists)
