# Dynamo graph DSCore.IO.FileSystem.GetDirectoryContents.dyn "DSCore.IO.FileSystem.GetDirectoryContents_img" (Dynamo 2.17.0.3255)

directory_path = Directory("C:\Temp\NewFolder")
directory_from_path = DirectoryObject(path=directory_path)
code_block = CodeBlock { "*.txt"; }
getDirectoryContents = FileSystem.GetDirectoryContents(directory=directory_from_path, searchString=code_block)
watch = Watch(getDirectoryContents.files)
