# Dynamo graph DSCore.IO.FileSystem.MoveFile.dyn "DSCore.IO.FileSystem.MoveFile_img" (Dynamo 2.17.0.3255)

file_path = Filename("No file selected.")
directory_path = Directory("No file selected.")
fileName = FileSystem.FileName(path=file_path)
combinePath = FileSystem.CombinePath(string0=directory_path, string1=fileName)
moveFile = FileSystem.MoveFile(path=file_path, newPath=combinePath)
