# Dynamo graph DSCore.IO.FileSystem.ReadText.dyn "FileSystem.ReadText" (Dynamo 2.14.0.3835)

string = StringInput(".\sample.txt")
file_from_path = FileObject(path=string)
readText = FileSystem.ReadText(file=file_from_path)
watch = Watch(readText)
