# Dynamo graph DSCore.IO.FileSystem.WriteText.dyn "DSCore.IO.FileSystem.WriteText_img" (Dynamo 2.17.0.3255)

file_path = Filename("..\..\..\..\..\..\..\..\..\..\Temp\sample.txt")
code_block = CodeBlock { "\r\n"; }
code_block_2 = CodeBlock { ["1","2","3"]; }
join = String.Join(separator=code_block, string0=code_block_2)
writeText = FileSystem.WriteText(filePath=file_path, text=join)
