# Dynamo graph DSCore.IO.Image.Pixels.dyn "DSCore.IO.Image.Pixels_img" (Dynamo 2.17.0.3255)

file_path = Filename("..\..\..\..\..\..\..\..\..\..\Temp\sample.png")
file_from_path = FileObject(path=file_path)
readFromFile = Image.ReadFromFile(file=file_from_path)
code_block = CodeBlock { 100; 100; }
pixels = Image.Pixels(image=readFromFile, xSamples=code_block.out0, ySamples=code_block.out1)
watch = Watch(pixels)
