# Dynamo graph DSCore.List.AllTrue.dyn (Dynamo 2.19.0.5742)

boolean = BoolSelector(true)  # graph input
boolean_2 = BoolSelector(false)  # graph input
create = List.Create(item0=boolean, item1=boolean_2)
watch = Watch(create)
allTrue = List.AllTrue(list=watch)
watch_2 = Watch(allTrue)
create_2 = List.Create(item0=boolean, item1=boolean)
watch_3 = Watch(create_2)
allTrue_2 = List.AllTrue(list=watch_3)
watch_4 = Watch(allTrue_2)
create_3 = List.Create(item0=create, item1=create_2)
watch_5 = Watch(create_3)
allTrue_3 = List.AllTrue(list=watch_5)
watch_6 = Watch(allTrue_3)
allTrue_4 = List.AllTrue(list=watch_5@L2)
watch_7 = Watch(allTrue_4)
