# Dynamo graph DSCore.List.AnyTrue.dyn (Dynamo 2.19.0.5742)

code_block = CodeBlock { true; true; false; }
list_create = List.Create(item0=code_block.out0, item1=code_block.out1, item2=code_block.out2)
anyTrue = List.AnyTrue(list=list_create)
watch = Watch(anyTrue)
