# Dynamo graph DSCore.List.Contains.dyn (Dynamo 2.19.0.5742)

code_block = CodeBlock()
# ---------- code_block.designscript (6 lines) ----------
"The only way to do great work is to love what you do. - Steve Jobs";
"If you want to go fast, go alone. If you want to go far, go together. - African Proverb";
"The man who moves a mountain begins by carrying away small stones. - Confucius";
"Don't watch the clock;
 do what it does. Keep going. - Sam Levenson";
"The best way to predict your future is to create it. - Abraham Lincoln";
# ----------------------------------------
list_create = List.Create(item0=code_block.out0, item1=code_block.out1, item2=code_block.out2, item3=code_block.out3, item4=code_block.out4)
code_block_2 = CodeBlock { "The best way to predict your future is to create it. - Abraham Lincoln"; }
contains = List.Contains(list=list_create, item=code_block_2)
watch = Watch(contains)
