# Dynamo graph DSCore.List.IndexOf.dyn (Dynamo 2.19.0.5742)

code_block = CodeBlock { 0..19..#11; }
watch = Watch(code_block)
code_block_2 = CodeBlock { 3.8; }
indexOf = List.IndexOf(list=watch, element=code_block_2)
watch_2 = Watch(indexOf)
