# Dynamo graph DSCore.List.SetDifference.dyn (Dynamo 2.19.0.5742)

code_block = CodeBlock { 0..9..#10; }
watch = Watch(code_block)
code_block_2 = CodeBlock { 0..18..#10; }
watch_2 = Watch(code_block_2)
setDifference = List.SetDifference(list1=watch, list2=watch_2)
watch_3 = Watch(setDifference)
