# Dynamo graph DSCore.Math.Abs(number).dyn "Math.Abs" (Dynamo 2.13.1.3887)

number = DoubleInput(-50)
number_2 = DoubleInput(0)
number_3 = DoubleInput(80)
list_create = List.Create(item0=number, item1=number_2, item2=number_3)
abs = Math.Abs(number=list_create)
watch = Watch(abs)
