# Dynamo graph DSCore.Math.Average.dyn (Dynamo 1.0.0.1180)

number_slider = DoubleSlider(10.6, range=-100..100 step 0.1)
number_slider_2 = DoubleSlider(47.5, range=-100..100 step 0.1)
number_slider_3 = DoubleSlider(80.1, range=-100..100 step 0.1)
create = List.Create(number_slider, number_slider_2, number_slider_3)
average = Math.Average(create)
watch = Watch(average)
