# Dynamo graph DSCore.Math.DegreesToRadians.dyn (Dynamo 1.0.0.1180)

number_slider = DoubleSlider(155, range=-360..360 step 1)
degreesToRadians = Math.DegreesToRadians(number_slider)
watch = Watch(degreesToRadians)
