# Dynamo graph DSCore.Math.EvaluateFormula.dyn "EvaluateFormula" (Dynamo 2.1.0.5357)

string = StringInput("a*(b+c)")
code_block = CodeBlock { "a".."c"; }
code_block_2 = CodeBlock { 1..3; }
evaluateFormula = Math.EvaluateFormula(formulaString=string, parameters=code_block, args=code_block_2)
