# Dynamo graph DSCore.Math.Random(value1, value2).dyn (Dynamo 1.0.0.1180)

integer_slider = IntegerSlider(12, range=0..100 step 1)
integer_slider_2 = IntegerSlider(53, range=0..100 step 1)
random = Math.Random(integer_slider, integer_slider_2)
watch = Watch(random)
