# Dynamo graph DSCore.Math.Xor.dyn (Dynamo 2.19.0.5742)

code_block = CodeBlock { [true,true,false,false]; [true,false,true,false]; }
watch = Watch(code_block.out0)
watch_2 = Watch(code_block.out1)
xor = Math.Xor(bool=watch, otherBool=watch_2)
watch_3 = Watch(xor)
