# Dynamo graph DSCore.String.Center.dyn "Center" (Dynamo 2.0.1.5055)

string = StringInput("Hello World")  # graph input
integer_slider = IntegerSlider(30, range=0..100 step 1)  # graph input
string_2 = StringInput("_")  # graph input
center = String.Center(str=string, newWidth=integer_slider, padChars=string_2)
watch = Watch(center)
