# Dynamo graph DSCore.String.Concat.dyn "Concat" (Dynamo 2.0.1.5055)

string = StringInput("Hello")  # graph input
string_2 = StringInput("World")  # graph input
concat = String.Concat(string0=string, string1=string_2)
watch = Watch(concat)
