# Dynamo graph DSCore.String.EndsWith.dyn "EndsWith" (Dynamo 2.0.1.5055)

string = StringInput("Hello World")  # graph input
string_2 = StringInput("orld")  # graph input
boolean = BoolSelector(true)  # graph input
endsWith = String.EndsWith(str=string, searchFor=string_2, ignoreCase=boolean)
watch = Watch(endsWith)
