# Dynamo graph DSCore.String.Insert.dyn "Insert" (Dynamo 2.0.1.5055)

string = StringInput("Hello World")  # graph input
integer_slider = IntegerSlider(4, range=0..15 step 1)  # graph input
string_2 = StringInput("HI!")  # graph input
insert = String.Insert(str=string, index=integer_slider, toInsert=string_2)
watch = Watch(insert)
