# Dynamo graph DSCore.String.Split.dyn "Split" (Dynamo 2.0.1.5055)

string = StringInput("Hello World")  # graph input
string_2 = StringInput("o")  # graph input
split = String.Split(str=string, separater0=string_2)
watch = Watch(split)
