# Dynamo graph DSCore.Thread.Pause.dyn (Dynamo 2.19.0.5742)

byCenterPointRadius = Circle.ByCenterPointRadius()
code_block = CodeBlock { 5000; }
pause = Thread.Pause(object=byCenterPointRadius, msTimeout=code_block)
extrude = Curve.Extrude(curve=pause)
