# Dynamo graph DSCore.TimeSpan.ByDateDifference.dyn "ByDateDifference" (Dynamo 2.0.1.5055)

now = DateTime.Now()
date_time = DateTime("2000-11-14T11:57:00Z")  # graph input
byDateDifference = TimeSpan.ByDateDifference(date1=now, date2=date_time)
watch = Watch(byDateDifference)
