# Dynamo graph DSCore.TimeSpan.FromString.dyn "FromString" (Dynamo 2.0.1.5055)

code_block = CodeBlock { "5:6:21"; }
fromString = TimeSpan.FromString(str=code_block)
watch = Watch(fromString)
components = TimeSpan.Components(timeSpan=watch)
watch_2 = Watch(components.hours)
watch_3 = Watch(components.minutes)
watch_4 = Watch(components.seconds)
