# Dynamo graph DesignScript.Builtin.Dictionary.Components.dyn "Components" (Dynamo 2.0.1.5055)

code_block = CodeBlock { ["foo","bar"]; [1,2]; }
byKeysValues = DesignScript.Builtin.Dictionary.ByKeysValues(keys=code_block.out0, values=code_block.out1)
components = DesignScript.Builtin.Dictionary.Components(dictionary=byKeysValues)
