# Dynamo graph DesignScript.Builtin.Dictionary.Count.dyn "Count" (Dynamo 2.0.1.5055)

code_block = CodeBlock { ["foo","bar"]; [1,2]; }
byKeysValues = DesignScript.Builtin.Dictionary.ByKeysValues(keys=code_block.out0, values=code_block.out1)
count = DesignScript.Builtin.Dictionary.Count(dictionary=byKeysValues)
