# Dynamo graph DynamoUnits.Location.ByLatitudeAndLongitude.dyn "ByLatitudeAndLongitude" (Dynamo 2.0.1.5055)

code_block = CodeBlock { 45.5231; }
code_block_2 = CodeBlock { -122.679565; }
code_block_3 = CodeBlock { "Portland"; }
byLatitudeAndLongitude = DynamoUnits.Location.ByLatitudeAndLongitude(latitude=code_block, longitude=code_block_2, name=code_block_3)
watch = Watch(byLatitudeAndLongitude)
