# Dynamo graph DynamoUnits.Unit.QuantitiesContainingUnit.dyn "Unit.QuantitiesContainingUnit" (Dynamo 2.14.0.3835)

units = Units("Feet")
quantitiesContainingUnit = DynamoUnits.Unit.QuantitiesContainingUnit(unit=units)
watch = Watch(quantitiesContainingUnit)
