# Dynamo graph DynamoUnits.Utilities.ParseExpressionByUnit.dyn "Utilities.ParseExpressionByUnit" (Dynamo 2.13.1.3887)

units = Units("Feet")
string = StringInput("1' 4\" + 10m + 107mm")
parseExpressionByUnit = DynamoUnits.Utilities.ParseExpressionByUnit(targetUnit=units, expression=string)
watch = Watch(parseExpressionByUnit)
