# Dynamo graph EEK2MZQNIS3F4JP5TCEY6FFPZJ6INBUWD2P7FWPXS6O7IBVMTZCQ.dyn "ByControlPoints" (Dynamo 2.0.1.5055)

code_block = CodeBlock { 6; }
randomList = Math.RandomList(amount=code_block)
code_block_2 = CodeBlock(x=randomList) { x*15; }
sort = List.Sort(list=code_block_2)
randomList_2 = Math.RandomList(amount=code_block)
code_block_3 = CodeBlock(x=randomList_2) { x*15; }
sort_2 = List.Sort(list=code_block_3)
byCoordinates = Point.ByCoordinates(x=sort, y=sort_2)
code_block_4 = CodeBlock { 3; }
boolean = BoolSelector(false)  # graph input
byControlPoints = NurbsCurve.ByControlPoints(points=byCoordinates, degree=code_block_4, closeCurve=boolean)
