# Dynamo graph GYGTDRZBKUXMUX6NHZN4KHZ5XUBTIO3F5BLLADD7ADVJ2SMJZLCA.dyn "Autodesk.DesignScript.Geometry.Geometry.Scale" (Dynamo 2.19.0.5914)

code_block = CodeBlock { location = 1; }
# note: Point to scale "from"
byCoordinates = Point.ByCoordinates(x=code_block, y=code_block)
# note: Geometry to scale
byCenterPointRadius = Circle.ByCenterPointRadius(centerPoint=byCoordinates)
# note: Basepoint from which to Scale geometry around
byCoordinates_2 = Point.ByCoordinates()
code_block_2 = CodeBlock { location = 10; }
# note: Point to scale "to"
byCoordinates_3 = Point.ByCoordinates(x=code_block_2, y=code_block_2)
# note: This node will scale your geometry around a given base point (Move your geometry to that point) by the total scale factor of the distance between the "from" and "to" points.
scale = Geometry.Scale(geometry=byCenterPointRadius, basePoint=byCoordinates_2, from=byCoordinates, to=byCoordinates_3)
