# Dynamo graph GeometryUIWpf.PanelSurfaceBoundaryConditionDropDown.dyn "Autodesk.DesignScript.Geometry.PanelSurface.ByCrossSplitSquares - Copy" (Dynamo 3.3.0.5155)

# group: Generate base surface
code_block = CodeBlock { width = 10; length = 20; }
byWidthLength = Rectangle.ByWidthLength(width=code_block.width, length=code_block.length)
byPatch = Surface.ByPatch(closedCurve=byWidthLength)

# group: Create Panels
u_number = DoubleInput(5)
v_number = DoubleInput(10)
boundaryConditions = PanelSurfaceBoundaryConditionDropDown("RemoveVertices")  # "PanelSurface.BoundaryConditions"
byHexagons = PanelSurface.ByHexagons(surface=byPatch, numU=u_number, numV=v_number, boundaryCondition=boundaryConditions)

# group: Convert Panels to Surfaces
getPanelPolygon = PanelSurface.GetPanelPolygon(panelSurface=byHexagons)
