# Dynamo graph H54SEHAY3YGO3MOAVNNGUJ3QI6IP6X6CQRV54A3GDLT46TUD6UHA.dyn "Autodesk.DesignScript.Geometry.TSpline.TSplineSurface.ByConePointRadii" (Dynamo 2.19.3.6543)

number_slider = DoubleSlider(-10, range=-10..100 step 0.1)
byCoordinates = Point.ByCoordinates(x=number_slider)
number_slider_2 = DoubleSlider(20, range=0..100 step 0.1)
byCoordinates_2 = Point.ByCoordinates(z=number_slider_2)
code_block = CodeBlock { 12; 4; 10; }
code_block_2 = CodeBlock { 8; 5; }
boolean = BoolSelector(false)
boolean_2 = BoolSelector(true)
boolean_3 = BoolSelector(false)
byAxial = TSpline.TSplineInitialSymmetry.ByAxial(xAxis=boolean, yAxis=boolean_2, zAxis=boolean_3)
boolean_4 = BoolSelector(true)
byConePointsRadii = TSpline.TSplineSurface.ByConePointsRadii(startPoint=byCoordinates, endPoint=byCoordinates_2, startRadius=code_block.out2, endRadius=code_block.out1, radiusSpans=code_block_2.out0, heightSpans=code_block_2.out1, symmetry=byAxial, inSmoothMode=boolean_4)
