# Dynamo graph KIWQMTKYTV555M5VBMXQPP5T2SOWPLBC5NHE2QXRVMJY5EJJY7BA.dyn "Autodesk.DesignScript.Geometry.Vector.Rotate" (Dynamo 2.19.0.5742)

code_block = CodeBlock { 1; }
# note: Original Vector, starting at x = 0, y = 0, z = 0 and directed at x = 1, y = 0. z = 1 and a length = 1.414
byCoordinates = Vector.ByCoordinates(x=code_block, z=code_block)

# group: Original Vector visualization
origin = Point.Origin()
code_block_2 = CodeBlock { length = 10; }
# note: Visualizing the original vector with a line of Length = 10
byStartPointDirectionLength = Line.ByStartPointDirectionLength(startPoint=origin, direction=byCoordinates, length=code_block_2)

XY = Plane.XY()
code_block_3 = CodeBlock { degrees = 90; }
# note: Now we rotate this vector around the XY Plane by 90 degrees, giving us a new Vector of x = 0, y = 1, z = 1 with a length = 1.414
rotate = Vector.Rotate(vector=byCoordinates, plane=XY, degrees=code_block_3)

# group: New Vector visualization
# note: Visutalizing the new vector with a line of Length = 10
byStartPointDirectionLength_2 = Line.ByStartPointDirectionLength(startPoint=origin, direction=rotate, length=code_block_2)
