# Dynamo graph LUVHU25JWECNEBKIBZFH6N5EUAM42XM3BSEOTMCI3TQDNS5EKLXA.dyn "Autodesk.DesignScript.Geometry.Curve.SweepAsSolid" (Dynamo 2.19.0.5742)

code_block = CodeBlock { 2; }
byWidthLength = Rectangle.ByWidthLength(width=code_block)
code_block_2 = CodeBlock { 0..180..36; }
cos = Math.Cos(angle=code_block_2)
code_block_3 = CodeBlock(x=cos) { x-2; }
code_block_4 = CodeBlock { 0..5..1; }
byCoordinates = Point.ByCoordinates(x=code_block_3, z=code_block_4)
byPoints = NurbsCurve.ByPoints(points=byCoordinates)
sweepAsSolid = Curve.SweepAsSolid(curve=byWidthLength, path=byPoints)
