# Dynamo graph List.SortByFunction.dyn (Dynamo 2.19.0.5742)

code_block = CodeBlock { Math.RandomList(20); Math.RandomList(20); }
code_block_2 = CodeBlock(x=code_block.out0, y=code_block.out1) { Point.ByCoordinates(10*x,10*y); }
byControlPoints = NurbsCurve.ByControlPoints(points=code_block_2)
X = Point.X()  # unwired: point
sortByFunction = List.SortByFunction(list=code_block_2, sortFunction=X)
code_block_3 = CodeBlock { 10; }
translate = Geometry.Translate(geometry=sortByFunction, xTranslation=code_block_3)
byControlPoints_2 = NurbsCurve.ByControlPoints(points=translate)
Y = Point.Y()  # unwired: point
sortByFunction_2 = List.SortByFunction(list=code_block_2, sortFunction=Y)
code_block_4 = CodeBlock { 20; }
translate_2 = Geometry.Translate(geometry=sortByFunction_2, xTranslation=code_block_4)
byControlPoints_3 = NurbsCurve.ByControlPoints(points=translate_2)
