# Dynamo graph List.TrueForAll.dyn (Dynamo 2.19.0.5742)

code_block = CodeBlock { 0..10; }

# group: Check the list to see if all of the values are greater than 11.
# Expected result of 'TrueForAll' is false
code_block_2 = CodeBlock { 11; }
gt = _ > code_block_2  # unwired: x
trueForAll = List.TrueForAll(list=code_block, queryFunction=gt)

# group: Check the list to see if all of the values are less than 11.
# Expected result of 'TrueForAll' is true
code_block_3 = CodeBlock { 11; }
lt = _ < code_block_3  # unwired: x
trueForAll_2 = List.TrueForAll(list=code_block, queryFunction=lt)

# group: Check the list to see if all of the values are less than < 5.
# Expected result of 'TrueForAll' is false
code_block_4 = CodeBlock { 5; }
lt_2 = _ < code_block_4  # unwired: x
trueForAll_3 = List.TrueForAll(list=code_block, queryFunction=lt_2)
