# Dynamo graph List.TrueForAny.dyn (Dynamo 2.19.0.5742)

code_block = CodeBlock { 0..10; }

# group: Check the list to see if any of the values are greater than 11.
# Expected result of 'TrueForAny' is false
code_block_2 = CodeBlock { 11; }
gt = _ > code_block_2  # unwired: x
trueForAny = List.TrueForAny(list=code_block, queryFunction=gt)

# group: Check the list to see if any of the values are less than 5.
# Expected result of 'TrueForAny' is true
code_block_3 = CodeBlock { 5; }
lt = _ < code_block_3  # unwired: x
trueForAny_2 = List.TrueForAny(list=code_block, queryFunction=lt)
