# Dynamo graph M3VFMWB2QNLX6WXZAGO7A2KLFVYNTV3P6QYWKGHMXCJ2TEDO3KZQ.dyn (Dynamo 2.19.3.6543)

# group: List of curves
code_block = CodeBlock()
# ---------- code_block.designscript (10 lines) ----------
Point.ByCoordinates(0, 0, 0);
Point.ByCoordinates(50, -40, 30);
Point.ByCoordinates(90, -80, 70);
Point.ByCoordinates(110, -100, 100);
Point.ByCoordinates(-50, -40, 30);
Point.ByCoordinates(-90, -80, 70);
Point.ByCoordinates(-110, -100, 100);
Point.ByCoordinates(0, 40, 30);
Point.ByCoordinates(0, 80, 70);
Point.ByCoordinates(0, 100, 100);
# ----------------------------------------
create = List.Create(item0=code_block.out0, item1=code_block.out1, item2=code_block.out2, item3=code_block.out3)
byPoints = NurbsCurve.ByPoints(points=create)
create_2 = List.Create(item0=code_block.out0, item1=code_block.out7, item2=code_block.out8, item3=code_block.out9)
byPoints_2 = NurbsCurve.ByPoints(points=create_2)
create_3 = List.Create(item0=code_block.out0, item1=code_block.out4, item2=code_block.out5, item3=code_block.out6)
byPoints_3 = NurbsCurve.ByPoints(points=create_3)

create_4 = List.Create(item0=byPoints, item1=byPoints_2, item2=byPoints_3)
default_radius = CodeBlock { 15; }
snapping_tolerance = CodeBlock { 0.001; }
segments_count = CodeBlock { [2,6,12]; }
auto_handle_end = BoolSelector(false)
end_rotations = CodeBlock { [15,60,90]; }
end_radii = CodeBlock { [1,3,6]; }
end_positions = CodeBlock { [1,1,0.95]; }
boolean = BoolSelector(true)
buildPipes = TSpline.TSplineSurface.BuildPipes(curves=create_4, defaultRadius=default_radius, snappingTolerance=snapping_tolerance, segmentsCount=segments_count, autoHandleEnd=auto_handle_end, endRotations=end_rotations, endRadii=end_radii, endPositions=end_positions, inSmoothMode=boolean)
