# Dynamo graph M7MZHZHWH4ZKVKUYXLRW627FB62D73CFFTQ2Q4CDDYU24PMN4A2A.dyn "ByControlPoints" (Dynamo 2.0.1.5055)

code_block = CodeBlock { 6; }
randomList = Math.RandomList(amount=code_block)
sort = List.Sort(list=randomList)
randomList_2 = Math.RandomList(amount=code_block)
sort_2 = List.Sort(list=randomList_2)
byCoordinates = Point.ByCoordinates(x=sort, y=sort_2)
code_block_2 = CodeBlock { 3; }
byControlPoints = NurbsCurve.ByControlPoints(points=byCoordinates, degree=code_block_2)
