# Dynamo graph Modifiers.GeometryColor.BySurfaceColors.dyn "Modifiers.GeometryColor.BySurfaceColors_img" (Dynamo 2.17.0.3255)

code_block = CodeBlock { 4; }
byCenterPointRadius = Circle.ByCenterPointRadius(radius=code_block)
byPatch = Surface.ByPatch(closedCurve=byCenterPointRadius)
code_block_2 = CodeBlock { 200; 252; 41; 217; }
byARGB = Color.ByARGB(alpha=code_block_2.out0, red=code_block_2.out1, green=code_block_2.out2, blue=code_block_2.out3)
code_block_3 = CodeBlock { 20; 120; 41; 200; }
byARGB_2 = Color.ByARGB(alpha=code_block_3.out0, red=code_block_3.out1, green=code_block_3.out2, blue=code_block_3.out3)
list_create = List.Create(item0=byARGB, item1=byARGB_2)
bySurfaceColors = Modifiers.GeometryColor.BySurfaceColors(surface=byPatch, colors=list_create)
