# Dynamo graph NAWUT5OCSCDDXI56BOEKQ7CUY4GXWEKG7CU3SYRVPVT2RF4VOOKQ.dyn "TrimSegmentsByParameter" (Dynamo 2.0.1.5055)

code_block = CodeBlock { 6; }
randomList = Math.RandomList(amount=code_block)
code_block_2 = CodeBlock(x=randomList) { x*10; }
randomList_2 = Math.RandomList(amount=code_block)
code_block_3 = CodeBlock(x=randomList_2) { x*10; }
byCoordinates = Point.ByCoordinates(x=code_block_2, y=code_block_3)
byControlPoints = NurbsCurve.ByControlPoints(points=byCoordinates)
code_block_4 = CodeBlock { 0..1..0.1; }
boolean = BoolSelector(false)  # graph input
trimSegmentsByParameter = Curve.TrimSegmentsByParameter(curve=byControlPoints, parameters=code_block_4, discardEvenSegments=boolean)
