# Dynamo graph NE2FY5VUCEZ5FDNQJAZD74HKN3WQSOQJXNOQ77SK3PFIJQCTF23Q.dyn "Autodesk.DesignScript.Geometry.CoordinateSystem.Scale" (Dynamo 2.19.0.5742)

number = DoubleInput(2)
byCoordinates = Point.ByCoordinates(x=number, y=number)
byOriginVectors = CoordinateSystem.ByOriginVectors(origin=byCoordinates)
byOriginNormal = Plane.ByOriginNormal(origin=byCoordinates)
number_2 = DoubleInput(2)
# note: Note: This will scale the coordinate system "in place", by using the base coordinate system's origin for the plane input.
scale = CoordinateSystem.Scale(coordinateSystem=byOriginVectors, plane=byOriginNormal, xamount=number_2, yamount=number_2, zamount=number_2)
