# Dynamo graph PK6P6YKREOU7DHO6OXJFT6PUF5LSO2W7ZW4IOTGWYPW3BJYASCOQ.dyn "Autodesk.DesignScript.Geometry.TSpline.TSplineInitialSymmetry.ByRadial" (Dynamo 3.0.0.5795)

number_slider = DoubleSlider(0, range=0..100 step 1)
number_slider_2 = DoubleSlider(0, range=0..100 step 1)
number_slider_3 = DoubleSlider(40, range=0..100 step 1)
byCoordinates = Point.ByCoordinates(x=number_slider, y=number_slider_2, z=number_slider_3)
code_block = CodeBlock { 20; }
code_block_2 = CodeBlock { 9; }
code_block_3 = CodeBlock { 10; }
integer_slider = IntegerSlider(2, range=1..10 step 1)
byRadial = TSpline.TSplineInitialSymmetry.ByRadial(symmetricFaces=integer_slider)
boolean = BoolSelector(true)
byConePointsRadii = TSpline.TSplineSurface.ByConePointsRadii(endPoint=byCoordinates, startRadius=code_block, radiusSpans=code_block_2, heightSpans=code_block_3, symmetry=byRadial, inSmoothMode=boolean)
regularFaces = TSpline.TSplineTopology.RegularFaces(tSplineTopology=byConePointsRadii)
number_slider_4 = DoubleSlider(0, range=0..220 step 1)
getItemAtIndex = List.GetItemAtIndex(list=regularFaces, index=number_slider_4)
integer_slider_2 = IntegerSlider(20, range=0..100 step 1)
integer_slider_3 = IntegerSlider(20, range=0..100 step 1)
integer_slider_4 = IntegerSlider(10, range=0..100 step 1)
byCoordinates_2 = Vector.ByCoordinates(x=integer_slider_2, y=integer_slider_3, z=integer_slider_4)
code_block_4 = CodeBlock { 4; }
extrudeFaces = TSpline.TSplineSurface.ExtrudeFaces(tSplineSurface=byConePointsRadii, faces=getItemAtIndex, direction=byCoordinates_2, spans=code_block_4)
