# Dynamo graph PQ27ZE4XS2FHDBHXA6BY6FYFII5PDNG3ZXNQMB4GDZEPNQHUZH3A.dyn "Autodesk.DesignScript.Geometry.Surface.BySweep" (Dynamo 2.19.4.6632)

code_block = CodeBlock { 0..10..1; }
code_block_2 = CodeBlock { 0..360..36; }
sin = Math.Sin(angle=code_block_2)
byCoordinates = Point.ByCoordinates(y=code_block, z=sin)
byPoints = NurbsCurve.ByPoints(points=byCoordinates)
origin = Point.Origin()
ZAxis = Vector.ZAxis()
code_block_3 = CodeBlock { -90; }
rotate = Geometry.Rotate(geometry=byPoints, origin=origin, axis=ZAxis, degrees=code_block_3)
bySweep = Surface.BySweep(profile=byPoints, path=rotate)
