# Dynamo graph PythonNodeModels.PythonStringNode.dyn (Dynamo 2.19.0.4746)

file_path = Filename(".\PythonScript.txt")
readText = FileSystem.ReadText(file=file_path)
byCorners = Cuboid.ByCorners()
origin = Point.Origin()
axis_vector = CodeBlock { Vector.ByCoordinates(1,0.5,0.5); }
degrees = CodeBlock { 10; }
rotate = Geometry.Rotate(geometry=byCorners, origin=origin, axis=axis_vector, degrees=degrees)
seed = CodeBlock { 3; }
xcount_ycount = CodeBlock { 10; }
python_script_from_string = PythonStringNode(script=readText, IN[0]=rotate, IN[1]=seed, IN[2]=xcount_ycount, IN[3]=xcount_ycount)  # CPython3
