# Dynamo graph RJA3JYUP36W2AR37ZYMWTK2ZDSFS6YXA5LMXE5CAYOZZDO6754CQ.dyn "Autodesk.DesignScript.Geometry.TSpline.TSplineSurface.ExtrudeEdgesAlongCurve" (Dynamo 2.19.3.6543)

code_block = CodeBlock()
# ---------- code_block.designscript (9 lines) ----------
point1 = Point.ByCoordinates(0, 0, 0);
point2 = Point.ByCoordinates(3, 0, 0);
point3 = Point.ByCoordinates(4, 0, 2);
point4 = Point.ByCoordinates(4, 0, 5);
point5 = Point.ByCoordinates(4, 0, 7);
point6 = Point.ByCoordinates(4, 0, 10);
t1 = [point1, point2, point3, point4, point5, point6];
t2 = false;
nurbsCurve1 = NurbsCurve.ByControlPoints(t1, 3, t2);
# ----------------------------------------
code_block_2 = CodeBlock { 8; }
boolean = BoolSelector(true)
boolean_2 = BoolSelector(true)
byRevolve = TSpline.TSplineSurface.ByRevolve(profile=code_block.nurbsCurve1, radialSpans=code_block_2, axialSpans=code_block_2, uniform=boolean, inSmoothMode=boolean_2)
borderEdges = TSpline.TSplineTopology.BorderEdges(tSplineTopology=byRevolve)
code_block_3 = CodeBlock { 10..13; }
getItemAtIndex = List.GetItemAtIndex(list=borderEdges, index=code_block_3)
code_block_4 = CodeBlock { 10; }
byCoordinates = Point.ByCoordinates(z=code_block_4)
code_block_5 = CodeBlock { 7; 10; 18; 9; }
byCoordinates_2 = Point.ByCoordinates(y=code_block_5.out0, z=code_block_5.out1)
byCoordinates_3 = Point.ByCoordinates(y=code_block_5.out0, z=code_block_5.out3)
join = List.Join(list0=byCoordinates, list1=byCoordinates_2, list2=byCoordinates_3)
byPoints = NurbsCurve.ByPoints(points=join)
code_block_6 = CodeBlock { 4; }
extrudeEdgesAlongCurve = TSpline.TSplineSurface.ExtrudeEdgesAlongCurve(tSplineSurface=byRevolve, edges=getItemAtIndex, curve=byPoints, spans=code_block_6)
code_block_7 = CodeBlock { 10; }
translate = Geometry.Translate(geometry=extrudeEdgesAlongCurve, xTranslation=code_block_7)
