# Dynamo graph SFB4J46343LP6YKDRW2FPILSS6UXITLDXWQKYJRD6LWHQJY2IYOA.dyn "Autodesk.DesignScript.Geometry.TSpline.TSplineSurface.ByPlaneLineAndPoint" (Dynamo 2.19.3.6543)

byCoordinates = Point.ByCoordinates()
code_block = CodeBlock { 5; 10; }
byCoordinates_2 = Point.ByCoordinates(x=code_block.out0, y=code_block.out0, z=code_block.out1)
byStartPointEndPoint = Line.ByStartPointEndPoint(startPoint=byCoordinates, endPoint=byCoordinates_2)
code_block_2 = CodeBlock { 10; 15; }
byCoordinates_3 = Point.ByCoordinates(x=code_block_2.out0, y=code_block_2.out1, z=code_block_2.out1)
code_block_3 = CodeBlock { 5; 20; }
byCoordinates_4 = Point.ByCoordinates(x=code_block_3.out0, y=code_block_3.out1)
code_block_4 = CodeBlock { 3; 4; }
boolean = BoolSelector(false)
byAxial = TSpline.TSplineInitialSymmetry.ByAxial(xAxis=boolean, yAxis=boolean, zAxis=boolean)
boolean_2 = BoolSelector(true)
byPlaneLineAndPoint = TSpline.TSplineSurface.ByPlaneLineAndPoint(line=byStartPointEndPoint, point=byCoordinates_3, maxCorner=byCoordinates_4, xSpans=code_block_4.out0, ySpans=code_block_4.out1, symmetry=byAxial, inSmoothMode=boolean_2)
