# Dynamo graph T4ELVGYIGJW62SQ52OSQTHK7FD4HPDADDXLQ3W54SUACRRXKXZGQ.dyn "ByCenterPointStartPointSweepAngle" (Dynamo 2.0.1.5055)

code_block = CodeBlock { 2; }
randomList = Math.RandomList(amount=code_block)
code_block_2 = CodeBlock(x=randomList) { x*8; }
randomList_2 = Math.RandomList(amount=code_block)
code_block_3 = CodeBlock(x=randomList_2) { x*8; }
byCoordinates = Point.ByCoordinates(x=code_block_2, y=code_block_3)
code_block_4 = CodeBlock { 0; 1; }
getItemAtIndex = List.GetItemAtIndex(list=byCoordinates, index=code_block_4.out0)
getItemAtIndex_2 = List.GetItemAtIndex(list=byCoordinates, index=code_block_4.out1)
number_slider = DoubleSlider(246.8, range=1..360 step 0.1)  # graph input
ZAxis = Vector.ZAxis()
byCenterPointStartPointSweepAngle = Arc.ByCenterPointStartPointSweepAngle(centerPoint=getItemAtIndex, startPoint=getItemAtIndex_2, sweepAngle=number_slider, normal=ZAxis)
