# Dynamo graph TAX4CBLVHC7JXO4PNOKK44X5VVCC377TK4Q3R5UBTYQROUPG4VCQ.dyn "Autodesk.DesignScript.Geometry.TSpline.TSplineSurface.ByTorusCenterRadii" (Dynamo 2.19.3.6543)

code_block = CodeBlock { 6; 2; }
byCoordinates = Point.ByCoordinates(x=code_block.out0, y=code_block.out0, z=code_block.out1)
code_block_2 = CodeBlock { 2; 4; }
code_block_3 = CodeBlock { 3; 6; }
code_block_4 = CodeBlock { 1; }
byRadial = TSpline.TSplineInitialSymmetry.ByRadial(symmetricFaces=code_block_4)
boolean = BoolSelector(true)
byTorusCenterRadii = TSpline.TSplineSurface.ByTorusCenterRadii(center=byCoordinates, innerRadius=code_block_2.out0, outerRadius=code_block_2.out1, innerRadiusSpans=code_block_3.out0, outerRadiusSpans=code_block_3.out1, symmetry=byRadial, inSmoothMode=boolean)
