# Dynamo graph Tessellation.Delaunay.ByParametersOnSurface.dyn "Tessellation.Delaunay.ByParametersOnSurface_img" (Dynamo 2.17.0.3255)

code_block = CodeBlock { Math.RandomList(400); Math.RandomList(400); }
byCoordinates = UV.ByCoordinates(u=code_block.out0, v=code_block.out1)
code_block_2 = CodeBlock()
# ---------- code_block_2.designscript (6 lines) ----------
pt1 = Point.ByCoordinates(0,0);
pt2 = Point.ByCoordinates(8,0);
pt3 = Point.ByCoordinates(12,12);
pt4 = Point.ByCoordinates(6,6,4);
pt5 = Point.ByCoordinates(0,16,-2);
pts = [pt1,pt2,pt3,pt4,pt5];
# ----------------------------------------
boolean = BoolSelector(true)
byControlPoints = NurbsCurve.ByControlPoints(points=code_block_2.pts, closeCurve=boolean)
byPatch = Surface.ByPatch(closedCurve=byControlPoints)
byParametersOnSurface = Tessellation.Delaunay.ByParametersOnSurface(uvs=byCoordinates, face=byPatch)
