# Dynamo graph U35TWGXYHIE46AYX3QP45IXNCZJAFUT62AN4GKHWSYFDMJWZ2WZQ.dyn "Autodesk.DesignScript.Geometry.TSpline.TSplineSurface.ByCombinedTSplineSurfaces" (Dynamo 2.19.3.6543)

code_block = CodeBlock { point1 = Point.ByCoordinates(10, 0, 0); 4; 0; 180; vector1 = Vector.ByCoordinates(0, 1, 0); }
byCenterPointRadiusAngle = Arc.ByCenterPointRadiusAngle(center=code_block.point1, radius=code_block.out1, startAngle=code_block.out2, endAngle=code_block.out3, normal=code_block.vector1)
code_block_2 = CodeBlock { 10; }
code_block_3 = CodeBlock { 5; 90; }
byCenterPointRadiusAngle_2 = Arc.ByCenterPointRadiusAngle(radius=code_block_2, startAngle=code_block_3.out0, endAngle=code_block_3.out1)
boolean = BoolSelector(false)
code_block_4 = CodeBlock { 3; 3; }
boolean_2 = BoolSelector(true)
bySweep = TSpline.TSplineSurface.BySweep(profile=byCenterPointRadiusAngle, path=byCenterPointRadiusAngle_2, parallel=boolean, pathSpans=code_block_4.out0, profileSpans=code_block_4.out1, inSmoothMode=boolean_2)
YZ = Plane.YZ()
mirror = Geometry.Mirror(geometry=bySweep, mirrorPlane=YZ)
join = List.Join(list0=bySweep, list1=mirror)
byCombinedTSplineSurfaces = TSpline.TSplineSurface.ByCombinedTSplineSurfaces(tSplineSurfaces=join)
watch = Watch(byCombinedTSplineSurfaces)
