# Dynamo graph WC63DIVH2PMDYNEMXAKVSTWOLAWHKDASMASHVO3GK3SW7CAXFLDA.dyn "Autodesk.DesignScript.Geometry.CoordinateSystem.Translate" (Dynamo 2.19.0.5742)

byOrigin = CoordinateSystem.ByOrigin()
number_slider = DoubleSlider(3.8, range=0..5 step 0.1)  # graph input
number_slider_2 = DoubleSlider(2.7, range=0..5 step 0.1)  # graph input
number_slider_3 = DoubleSlider(0.8, range=0..4 step 0.1)  # graph input
translate = CoordinateSystem.Translate(coordinateSystem=byOrigin, xTranslation=number_slider, yTranslation=number_slider_2, zTranslation=number_slider_3)
byRadiusHeight = Cylinder.ByRadiusHeight(coordinateSystem=translate)
color_palette = ColorPalette({R: 100, G: 141, B: 198, A: 146})
byGeometryColor = Modifiers.GeometryColor.ByGeometryColor(geometry=byRadiusHeight, color=color_palette)
