# Dynamo graph WG4273QZLTXFNOZTJWMFHD4JKB67IIQBJCQNC5SMOC43VJNXKACA.dyn "Autodesk.DesignScript.Geometry.TSpline.TSplineSurface.ByConeCoordinateSystemHeightRadius" (Dynamo 2.19.3.6543)

number_slider = DoubleSlider(10, range=0..100 step 1)
number_slider_2 = DoubleSlider(10, range=0..100 step 1)
number_slider_3 = DoubleSlider(0, range=-10..100 step 1)
byOrigin = CoordinateSystem.ByOrigin(x=number_slider, y=number_slider_2, z=number_slider_3)
code_block = CodeBlock { 6; 10; }
code_block_2 = CodeBlock { 8; 5; }
boolean = BoolSelector(true)
boolean_2 = BoolSelector(true)
boolean_3 = BoolSelector(true)
byAxial = TSpline.TSplineInitialSymmetry.ByAxial(xAxis=boolean, yAxis=boolean_2, zAxis=boolean_3)
boolean_4 = BoolSelector(true)
byConeCoordinateSystemHeightRadius = TSpline.TSplineSurface.ByConeCoordinateSystemHeightRadius(cs=byOrigin, height=code_block.out0, radius=code_block.out1, radiusSpans=code_block_2.out0, heightSpans=code_block_2.out1, symmetry=byAxial, inSmoothMode=boolean_4)
