# Dynamo graph Autodesk.DesignScript.Geometry.TSpline.TSplineSurface.IsInBoxMode.dyn (Dynamo 2.19.3.6543)

code_block = CodeBlock { 20; }
byCoordinates = Point.ByCoordinates(x=code_block, y=code_block)
code_block_2 = CodeBlock { 3; }
boolean = BoolSelector(true)
byPlaneOriginNormal = TSpline.TSplineSurface.ByPlaneOriginNormal(maxCorner=byCoordinates, xSpans=code_block_2, ySpans=code_block_2, inSmoothMode=boolean)
code_block_3 = CodeBlock { [0,4]; }
faceByIndex = TSpline.TSplineTopology.FaceByIndex(tSplineTopology=byPlaneOriginNormal, index=code_block_3)
deleteFaces = TSpline.TSplineSurface.DeleteFaces(tSplineSurface=byPlaneOriginNormal, faces=faceByIndex)
isInBoxMode = TSpline.TSplineSurface.IsInBoxMode(tSplineSurface=deleteFaces)
watch = Watch(isInBoxMode)
