# Dynamo graph DSCore.List.DiagonalRight.dyn (Dynamo 2.19.0.5742)

number_range = CodeBlock()
# ---------- number_range.designscript (2 lines) ----------
//Range from -5 to 5, with 5 total points
-5..5..#5;
# ----------------------------------------
byCoordinates = Point.ByCoordinates(x=number_range, y=number_range, lacing=CrossProduct)
number = DoubleInput(5)
diagonalRight = List.DiagonalRight(list=byCoordinates, subLength=number)
count = List.Count(list=diagonalRight@L2)
number_2 = DoubleInput(1)
eq = count == number_2
not_ = Not(x=eq)
filterByBoolMask = List.FilterByBoolMask(list=diagonalRight, mask=not_)
byBestFitThroughPoints = Line.ByBestFitThroughPoints(bestFitPoints=filterByBoolMask.in)
watch = Watch(diagonalRight)
watch_2 = Watch(byCoordinates)
