# Dynamo graph DSCore.Math.Pow.dyn (Dynamo 1.0.0.1180)

number_slider = DoubleSlider(6, range=0..10 step 0.1)
number_slider_2 = DoubleSlider(2.9, range=0..10 step 0.1)
pow = Math.Pow(number=number_slider, power=number_slider_2)
watch = Watch(pow)
