# Dynamo graph LH2OMC6QECNGXILBERSJIZPNQ7BJYOSSOBDJC2VICMMYXJ7BJRUA.dyn "Autodesk.DesignScript.Geometry.CoordinateSystem.Scale" (Dynamo 2.19.0.5742)

origin = Point.Origin()
byOriginVectors = CoordinateSystem.ByOriginVectors(origin=origin)
number_slider = DoubleSlider(3.5, range=0..10 step 0.1)  # graph input
scale = CoordinateSystem.Scale(coordinateSystem=byOriginVectors, amount=number_slider)
