# Dynamo graph Autodesk.DesignScript.Geometry.BoundingBox.IsEmpty.dyn "IsEmpty" (Dynamo 2.17.0.2403)

byCorners = BoundingBox.ByCorners()
toCuboid = BoundingBox.ToCuboid(boundingBox=byCorners)
code_block = CodeBlock(geometry=toCuboid) { color = Color.ByARGB(100,141,198,217); GeometryColor.ByGeometryColor(geometry, color); }
number_slider = DoubleSlider(3.1, range=1..10 step 0.1)  # graph input
code_block_2 = CodeBlock(multiplier=number_slider)
# ---------- code_block_2.designscript (5 lines) ----------
x = Math.RandomList(1)*multiplier;
y = Math.RandomList(1)*multiplier;
z = Math.RandomList(1)*multiplier;
pts = Point.ByCoordinates(x,y,z);
Sphere.ByCenterPointRadius(pts,1);
# ----------------------------------------
isEmpty = BoundingBox.IsEmpty(boundingBox=byCorners)
watch = Watch(isEmpty)
