# Dynamo graph Autodesk.DesignScript.Geometry.CoordinateSystem.ByOrigin(origin).dyn "ByOrigin" (Dynamo 2.0.1.5055)

code_block = CodeBlock { 4; }
byCoordinates = Point.ByCoordinates(x=code_block, y=code_block)
byOrigin = CoordinateSystem.ByOrigin(origin=byCoordinates)
watch = Watch(byOrigin)
