# Dynamo graph DSCore.String.Join.dyn "Join" (Dynamo 2.0.1.5055)

string = StringInput("_")  # graph input
string_2 = StringInput("Hello")  # graph input
string_3 = StringInput("World")  # graph input
string_4 = StringInput("HI!")  # graph input
join = String.Join(separator=string, string0=string_2, string1=string_3, string2=string_4)
watch = Watch(join)
