# Dynamo graph DSCore.String.StartsWith.dyn "StartsWith" (Dynamo 2.0.1.5055)

string = StringInput("Hello World")  # graph input
string_2 = StringInput("h")  # graph input
boolean = BoolSelector(true)  # graph input
startsWith = String.StartsWith(str=string, searchFor=string_2, ignoreCase=boolean)
watch = Watch(startsWith)
