# Dynamo graph !=.dyn (Dynamo 2.19.0.5742)

number_slider = DoubleSlider(47.7, range=0..100 step 0.1)  # graph input
number_slider_2 = DoubleSlider(12.6, range=0..100 step 0.1)  # graph input
ne = number_slider != number_slider_2
watch = Watch(ne)
