# Dynamo graph 2SAWXHRQ333U2VRTKOVHZ2L5U6OPIQ2DHLI3MRGJWLXPMDUKVQZA.dyn (Dynamo 1.1.0.2093)

code_block = CodeBlock { 0..10..#20; }
code_block_2 = CodeBlock(x=code_block) { x*2; }
byCoordinates = Point.ByCoordinates(x=code_block_2, y=code_block_2, lacing=CrossProduct)
ZAxis = Vector.ZAxis()
count = Count(byCoordinates)
randomList = Math.RandomList(count)
scale = Vector.Scale(vector=ZAxis, scale_factor=randomList)
translate = Geometry.Translate(geometry=byCoordinates, direction=scale)
code_block_3 = CodeBlock { 1; }
code_block_4 = CodeBlock { 1..400..1; }
byCoordinates_2 = Vector.ByCoordinates(x=code_block_3, y=code_block_3, z=code_block_4)
code_block_5 = CodeBlock { 1; }
code_block_6 = CodeBlock { 1..400..1; }
byCoordinates_3 = Vector.ByCoordinates(x=code_block_5, y=code_block_5, z=code_block_6)
code_block_7 = CodeBlock { 1; }
code_block_8 = CodeBlock { 1..400..1; }
byCoordinates_4 = Vector.ByCoordinates(x=code_block_7, y=code_block_7, z=code_block_8)
code_block_9 = CodeBlock { 1; }
code_block_10 = CodeBlock { 1..400..1; }
byCoordinates_5 = Vector.ByCoordinates(x=code_block_9, y=code_block_9, z=code_block_10)
byPointsTangents = NurbsSurface.ByPointsTangents(translate, byCoordinates_2, byCoordinates_3, byCoordinates_4, byCoordinates_5)
byPointsTangentsKnotsDerivatives = NurbsSurface.ByPointsTangentsKnotsDerivatives()
