# Dynamo graph 3JL6REDTXILJYKG3YL47NDNEA5YHNLEAYOO3JNMRUUBMWI4GDGHA.dyn "Autodesk.DesignScript.Geometry.TSpline.TSplineTopology.TPointVertices" (Dynamo 2.13.1.3887)

# group: T-Spline Surface
code_block = CodeBlock { 50; }
byCoordinates = Point.ByCoordinates(x=code_block, y=code_block)
code_block_2 = CodeBlock { 4; 3; }
boolean = BoolSelector(true)
byPlaneOriginNormal = TSpline.TSplineSurface.ByPlaneOriginNormal(maxCorner=byCoordinates, xSpans=code_block_2.out0, ySpans=code_block_2.out0, inSmoothMode=boolean)
code_block_3 = CodeBlock { 5; }
faceByIndex = TSpline.TSplineTopology.FaceByIndex(tSplineTopology=byPlaneOriginNormal, index=code_block_3)
code_block_4 = CodeBlock { 5; }
byCoordinates_2 = Vector.ByCoordinates(z=code_block_4)
extrudeFaces = TSpline.TSplineSurface.ExtrudeFaces(tSplineSurface=byPlaneOriginNormal, faces=faceByIndex, direction=byCoordinates_2)
code_block_5 = CodeBlock { 2; }
faceByIndex_2 = TSpline.TSplineTopology.FaceByIndex(tSplineTopology=extrudeFaces, index=code_block_5)
boolean_2 = BoolSelector(false)
subdivideFaces = TSpline.TSplineSurface.SubdivideFaces(tSplineSurface=extrudeFaces, faces=faceByIndex_2, exact=boolean_2)
code_block_6 = CodeBlock { 10; }
faceByIndex_3 = TSpline.TSplineTopology.FaceByIndex(tSplineTopology=subdivideFaces, index=code_block_6)
deleteFaces = TSpline.TSplineSurface.DeleteFaces(tSplineSurface=subdivideFaces, faces=faceByIndex_3)
code_block_7 = CodeBlock { [10,14,30,34]; }
edgeByIndex = TSpline.TSplineTopology.EdgeByIndex(tSplineTopology=deleteFaces, index=code_block_7)
code_block_8 = CodeBlock { 3; }
fillHole = TSpline.TSplineSurface.FillHole(tSplineSurface=deleteFaces, edges=edgeByIndex, fillMethod=code_block_8)
code_block_9 = CodeBlock { 27; }
edgeByIndex_2 = TSpline.TSplineTopology.EdgeByIndex(tSplineTopology=fillHole, index=code_block_9)
unweldEdges = TSpline.TSplineSurface.UnweldEdges(tSplineSurface=fillHole, edges=edgeByIndex_2)

TPointVertices = TSpline.TSplineTopology.TPointVertices(tSplineTopology=unweldEdges)
watch = Watch(TPointVertices)
UVNFrame = TSpline.TSplineVertex.UVNFrame(tSplineVertex=TPointVertices)
position = TSpline.TSplineUVNFrame.Position(tSplineUVNFrame=UVNFrame)
vertexByIndex = TSpline.TSplineTopology.VertexByIndex()  # unwired: tSplineTopology, index
