# Dynamo graph 3W2XHZKQEZFB7P3OTUVOZUMCD3M7PKUFQZI42URWMPFARFIN2NVQ.dyn "Autodesk.Dynamo.Geometry.TSpline.TSplineSurface.BySphereCenterPointRadius" (Dynamo 2.19.3.6543)

code_block = CodeBlock { 4; }
byCoordinates = Point.ByCoordinates(x=code_block, y=code_block, z=code_block)
code_block_2 = CodeBlock { 4; 8; 6; }
boolean = BoolSelector(false)
boolean_2 = BoolSelector(true)
boolean_3 = BoolSelector(true)
byAxial = TSpline.TSplineInitialSymmetry.ByAxial(xAxis=boolean, yAxis=boolean_2, zAxis=boolean_3)
boolean_4 = BoolSelector(true)
bySphereCenterPointRadius = TSpline.TSplineSurface.BySphereCenterPointRadius(centerPoint=byCoordinates, radius=code_block_2.out0, radiusSpans=code_block_2.out1, heightSpans=code_block_2.out2, symmetry=byAxial, inSmoothMode=boolean_4)
