# Dynamo graph 5MRWZW5S4JJMDCAQNQWK32MPFTU5RFV6GLUOOMEN6FLMBO2FOFGQ.dyn "Autodesk.DesignScript.Geometry.TSpline.TSplineSurface.ExtrudeEdges" (Dynamo 2.19.3.6543)

code_block = CodeBlock()
# ---------- code_block.designscript (9 lines) ----------
point1 = Point.ByCoordinates(0, 0, 0);
point2 = Point.ByCoordinates(3, 0, 0);
point3 = Point.ByCoordinates(4, 0, 2);
point4 = Point.ByCoordinates(4, 0, 5);
point5 = Point.ByCoordinates(4, 0, 7);
point6 = Point.ByCoordinates(4, 0, 10);
t1 = [point1, point2, point3, point4, point5, point6];
t2 = false;
nurbsCurve1 = NurbsCurve.ByControlPoints(t1, 3, t2);
# ----------------------------------------
code_block_2 = CodeBlock { 8; }
boolean = BoolSelector(true)
boolean_2 = BoolSelector(true)
byRevolve = TSpline.TSplineSurface.ByRevolve(profile=code_block.nurbsCurve1, radialSpans=code_block_2, axialSpans=code_block_2, uniform=boolean, inSmoothMode=boolean_2)
borderEdges = TSpline.TSplineTopology.BorderEdges(tSplineTopology=byRevolve)
code_block_3 = CodeBlock { 16..31; }
getItemAtIndex = List.GetItemAtIndex(list=borderEdges, index=code_block_3)
code_block_4 = CodeBlock { -5; }
byCoordinates = Vector.ByCoordinates(y=code_block_4)
code_block_5 = CodeBlock { 2; }
extrudeEdges = TSpline.TSplineSurface.ExtrudeEdges(tSplineSurface=byRevolve, edges=getItemAtIndex, direction=byCoordinates, spans=code_block_5)
code_block_6 = CodeBlock { 15; }
translate = Geometry.Translate(geometry=extrudeEdges, yTranslation=code_block_6)
