# Dynamo graph 5NB3FDYBJDTGURCB4X7W2I7P2TIGXAXPEUVWUMM2BTWHJ3GXRJQA.dyn "Autodesk.DesignScript.Geometry.Curve.Extrude" (Dynamo 2.19.0.5874)

number = DoubleInput(5)
number_2 = DoubleInput(10)
number_3 = DoubleInput(15)
number_4 = DoubleInput(20)
list_create = List.Create(item0=number, item1=number_2, item2=number_3, item3=number_4)
list_create_2 = List.Create(item0=number_4, item1=number, item2=number_2, item3=number_3)
byCoordinates = Point.ByCoordinates(x=list_create, y=list_create_2)
byControlPoints = NurbsCurve.ByControlPoints(points=byCoordinates)
ZAxis = Vector.ZAxis()
number_5 = DoubleInput(5)
extrude = Curve.Extrude(curve=byControlPoints, direction=ZAxis, distance=number_5)
