# Dynamo graph 62R7TNV2KCZCI3DMDQF7KVWE5WHQRXUHIVL625TVQLCENC23EMBA.dyn "Autodesk.DesignScript.Geometry.Surface.ToNurbsSurface" (Dynamo 2.19.4.6632)

number_slider = DoubleSlider(6, range=3..10 step 1)  # graph input
code_block = CodeBlock(a=number_slider) { 0..360..360/(a-1); }
randomList = Math.RandomList(amount=number_slider)
code_block_2 = CodeBlock(x=randomList) { x*5; }
randomList_2 = Math.RandomList(amount=number_slider)
code_block_3 = CodeBlock(x=randomList_2) { x*5; }
byCylindricalCoordinates = Point.ByCylindricalCoordinates(angle=code_block, elevation=code_block_2, radius=code_block_3)
boolean = BoolSelector(true)  # graph input
byPoints = NurbsCurve.ByPoints(points=byCylindricalCoordinates, closeCurve=boolean)
byPatch = Surface.ByPatch(closedCurve=byPoints)
toNurbsSurface = Surface.ToNurbsSurface(surface=byPatch)
