# Dynamo graph 6Z5ORNUUOKVQFG6ZBYHMWKQR457NCZXFTI27PNFF3MSQGVPTVZ2A.dyn "Autodesk.DesignScript.Geometry.PolyCurve.ByGroupedCurves" (Dynamo 2.19.0.5874)

# group: Creating a pentagon, exploding it and randomizing the curves
number_slider = DoubleSlider(5, range=0..100 step 0.1)
byCenterPointRadius = Circle.ByCenterPointRadius(radius=number_slider)
regularPolygon = Polygon.RegularPolygon(circle=byCenterPointRadius, numberSides=number_slider)
explode = Geometry.Explode(geometry=regularPolygon)
# note: All curves are random and thus do not have an ordered way of being joined together.
shuffle = List.Shuffle(list=explode)

# note: This node will group curves based on their proximity to other curves, either touching or within a join tolerance to correct re-order and connect them into a single PolyCurve.
byGroupedCurves = PolyCurve.ByGroupedCurves(curves=shuffle)
