# Dynamo graph 7LRWGLADXMQPJN33WBBRTYBBK4NO6FQADRQICYVBDCTWPJ3FOONQ.dyn "Autodesk.DesignScript.Geometry.TSpline.TSplineTopology.VertexByIndex" (Dynamo 2.19.3.6543)

code_block = CodeBlock { 4; }
byCoordinates = Point.ByCoordinates(x=code_block, y=code_block, z=code_block)
code_block_2 = CodeBlock { 8; }
code_block_3 = CodeBlock { 3; }
boolean = BoolSelector(true)
byBoxLengths = TSpline.TSplineSurface.ByBoxLengths(origin=byCoordinates, width=code_block_2, length=code_block_2, height=code_block_2, xSpans=code_block_3, ySpans=code_block_3, zSpans=code_block_3, inSmoothMode=boolean)
integer_slider = IntegerSlider(10, range=0..25 step 1)
vertexByIndex = TSpline.TSplineTopology.VertexByIndex(tSplineTopology=byBoxLengths, index=integer_slider)
code_block_4 = CodeBlock { -1.5; }
byCoordinates_2 = Vector.ByCoordinates(y=code_block_4)
boolean_2 = BoolSelector(true)
moveVertices = TSpline.TSplineSurface.MoveVertices(tSplineSurface=byBoxLengths, vertices=vertexByIndex, vector=byCoordinates_2, onSurface=boolean_2)
