# Dynamo graph ARIV6OQ22ACATWAIKGM7OHNEJS2TQUOKUSEU6UNX6EAAVSJIMK3A.dyn "Autodesk.DesignScript.Geometry.TSpline.TSplineSurface.CompressIndices" (Dynamo 2.19.3.6543)

code_block = CodeBlock { 15; }
boolean = BoolSelector(true)
byQuadballCenterRadius = TSpline.TSplineSurface.ByQuadballCenterRadius(radius=code_block, inSmoothMode=boolean)
code_block_2 = CodeBlock { [0,1,2]; }
faceByIndex = TSpline.TSplineTopology.FaceByIndex(tSplineTopology=byQuadballCenterRadius, index=code_block_2)
deleteFaces = TSpline.TSplineSurface.DeleteFaces(tSplineSurface=byQuadballCenterRadius, faces=faceByIndex)
code_block_3 = CodeBlock { 1; }
edgeByIndex = TSpline.TSplineTopology.EdgeByIndex(tSplineTopology=deleteFaces, index=code_block_3)
edgesCount = TSpline.TSplineTopology.EdgesCount(tSplineTopology=deleteFaces)
watch = Watch(edgesCount)
compressIndexes = TSpline.TSplineSurface.CompressIndexes(tSplineSurface=deleteFaces)
code_block_4 = CodeBlock { 1; }
edgeByIndex_2 = TSpline.TSplineTopology.EdgeByIndex(tSplineTopology=compressIndexes, index=code_block_4)
