# Dynamo graph AUJIYC7MERJPYMO5VHIFF7FPJD5YMEBOHOMWKROVKZCF66ZIBZ2A.dyn "Autodesk.DesignScript.Geometry.CoordinateSystem.Rotate" (Dynamo 2.19.0.5742)

origin = Point.Origin()
byOriginVectors = CoordinateSystem.ByOriginVectors(origin=origin)
code_block = CodeBlock { Point.ByCoordinates(2,3); }
code_block_2 = CodeBlock { 1; }
byCoordinates = Vector.ByCoordinates(y=code_block_2)
rotation_degrees = DoubleSlider(47.8, range=0..100 step 0.1)  # graph input
rotate = CoordinateSystem.Rotate(coordinateSystem=byOriginVectors, origin=code_block, axis=byCoordinates, degrees=rotation_degrees)
