# Dynamo graph AUSALFCUDD62GV5ALRNIDJ43LBF3FWW5HY5WNAQBKRB7E2JF7WUQ.dyn "Autodesk.DesignScript.Geometry.TSpline.TSplineSurface.ByCylinderPointsRadius" (Dynamo 2.19.3.6543)

byCoordinates = Point.ByCoordinates()
code_block = CodeBlock { 5; }
byCoordinates_2 = Point.ByCoordinates(x=code_block, y=code_block, z=code_block)
code_block_2 = CodeBlock { 3; 9; 3; }
code_block_3 = CodeBlock { 1; }
byRadial = TSpline.TSplineInitialSymmetry.ByRadial(symmetricFaces=code_block_3)
boolean = BoolSelector(true)
byCylinderPointsRadius = TSpline.TSplineSurface.ByCylinderPointsRadius(startPoint=byCoordinates, endPoint=byCoordinates_2, radius=code_block_2.out0, radiusSpans=code_block_2.out1, heightSpans=code_block_2.out2, symmetry=byRadial, inSmoothMode=boolean)
