# Dynamo graph Analysis.Label.ByPointAndString.dyn (Dynamo 2.13.1.3887)

byCoordinates = Point.ByCoordinates()
string_from_object = FromObject(object=byCoordinates)
byPointAndString = Analysis.Label.ByPointAndString(point=byCoordinates, label=string_from_object)
watch_3d = Watch3D(byPointAndString)
