# Dynamo graph Autodesk.DesignScript.Geometry.Arc.ByCenterPointRadiusAngle.dyn "ByCenterPointRadiusAngle" (Dynamo 2.0.1.5055)

code_block = CodeBlock { 1; }
randomList = Math.RandomList(amount=code_block)
code_block_2 = CodeBlock(x=randomList) { x*8; }
randomList_2 = Math.RandomList(amount=code_block)
code_block_3 = CodeBlock(x=randomList_2) { x*8; }
byCoordinates = Point.ByCoordinates(x=code_block_2, y=code_block_3)
number_slider = DoubleSlider(9.5, range=0..100 step 0.1)  # graph input
number_slider_2 = DoubleSlider(91.3, range=0..100 step 0.1)  # graph input
number_slider_3 = DoubleSlider(17.6, range=0..100 step 0.1)  # graph input
ZAxis = Vector.ZAxis()
byCenterPointRadiusAngle = Arc.ByCenterPointRadiusAngle(center=byCoordinates, radius=number_slider, startAngle=number_slider_2, endAngle=number_slider_3, normal=ZAxis)
