# Dynamo graph Autodesk.DesignScript.Geometry.Arc.ByFillet.dyn "ByFillet" (Dynamo 2.0.1.5055)

code_block = CodeBlock { 1; }
randomList = Math.RandomList(amount=code_block)
code_block_2 = CodeBlock(x=randomList) { x*5; }
randomList_2 = Math.RandomList(amount=code_block)
code_block_3 = CodeBlock(x=randomList_2) { x*5; }
byCoordinates = Point.ByCoordinates(x=code_block_2, y=code_block_3)
YAxis = Vector.YAxis()
code_block_4 = CodeBlock { 5; }
byStartPointDirectionLength = Line.ByStartPointDirectionLength(startPoint=byCoordinates, direction=YAxis, length=code_block_4)
byCoordinates_2 = Point.ByCoordinates(x=code_block_3, y=code_block_2)
XAxis = Vector.XAxis()
byStartPointDirectionLength_2 = Line.ByStartPointDirectionLength(startPoint=byCoordinates_2, direction=XAxis, length=code_block_4)
number_slider = DoubleSlider(2.3, range=0..4 step 0.1)  # graph input
byFillet = Arc.ByFillet(curve1=byStartPointDirectionLength, curve2=byStartPointDirectionLength_2, radius=number_slider)
