# Dynamo graph Autodesk.DesignScript.Geometry.Arc.StartAngle.dyn "StartAngle" (Dynamo 2.0.1.5055)

code_block = CodeBlock { 3; }
randomList = Math.RandomList(amount=code_block)
code_block_2 = CodeBlock(x=randomList) { x*12; }
randomList_2 = Math.RandomList(amount=code_block)
code_block_3 = CodeBlock(x=randomList_2) { x*12; }
byCoordinates = Point.ByCoordinates(x=code_block_2, y=code_block_3)
code_block_4 = CodeBlock { 0; 1; 2; }
getItemAtIndex = List.GetItemAtIndex(list=byCoordinates, index=code_block_4.out0)
getItemAtIndex_2 = List.GetItemAtIndex(list=byCoordinates, index=code_block_4.out1)
getItemAtIndex_3 = List.GetItemAtIndex(list=byCoordinates, index=code_block_4.out2)
byThreePoints = Arc.ByThreePoints(firstPoint=getItemAtIndex, secondPoint=getItemAtIndex_2, thirdPoint=getItemAtIndex_3)
startAngle = Arc.StartAngle(arc=byThreePoints)
watch = Watch(startAngle)
