# Dynamo graph Autodesk.DesignScript.Geometry.BoundingBox.ByMinimumVolume.dyn (Dynamo 2.19.0.5742)

byCenterPointRadius = Sphere.ByCenterPointRadius()
code_block = CodeBlock { 1; 2.5; 0.5; }
scale = Geometry.Scale(geometry=byCenterPointRadius, xamount=code_block.out0, yamount=code_block.out1, zamount=code_block.out2)
byCoordinates = Point.ByCoordinates()
ZAxis = Vector.ZAxis()
code_block_2 = CodeBlock { 45; }
rotate = Geometry.Rotate(geometry=scale, origin=byCoordinates, axis=ZAxis, degrees=code_block_2)
byMinimumVolume = BoundingBox.ByMinimumVolume(geom=rotate)
toCuboid = BoundingBox.ToCuboid(boundingBox=byMinimumVolume)
number = DoubleInput(20)
byARGB = Color.ByARGB(alpha=number)
byGeometryColor = Modifiers.GeometryColor.ByGeometryColor(geometry=toCuboid, color=byARGB)
