# Dynamo graph Autodesk.DesignScript.Geometry.BoundingBox.ToPolySurface.dyn "ToPolySurface" (Dynamo 2.17.0.2403)

code_block = CodeBlock()
# ---------- code_block.designscript (5 lines) ----------
pt1 = Point.ByCoordinates(3,0,4);
pt2 = Point.ByCoordinates(4,-2,0);
pt3 = Point.ByCoordinates(0,3,4);

Sphere.ByCenterPointRadius([pt1, pt2, pt3],3);
# ----------------------------------------
byUnion = Solid.ByUnion(solids=code_block.out3)
boundingBox = Geometry.BoundingBox(geometry=byUnion)
toPolySurface = BoundingBox.ToPolySurface(boundingBox=boundingBox)
code_block_2 = CodeBlock(geometry=toPolySurface) { color = Color.ByARGB(100,141,198,217); GeometryColor.ByGeometryColor(geometry, color); }
