# Dynamo graph Autodesk.DesignScript.Geometry.Cone.ByPointsRadius.dyn "ByPointsRadius" (Dynamo 2.0.1.5055)

origin = Point.Origin()
ZAxis = Vector.ZAxis()
number_slider = DoubleSlider(4.7, range=0..10 step 0.1)  # graph input
translate = Geometry.Translate(geometry=origin, direction=ZAxis, distance=number_slider)
number_slider_2 = DoubleSlider(4.7, range=0..10 step 0.1)  # graph input
byPointsRadius = Cone.ByPointsRadius(startPoint=origin, endPoint=translate, startRadius=number_slider_2)
