# Dynamo graph Autodesk.DesignScript.Geometry.Cone.RadiusRatio.dyn "RadiusRatio" (Dynamo 2.0.1.5055)

origin = Point.Origin()
ZAxis = Vector.ZAxis()
number_slider = DoubleSlider(4.7, range=0..10 step 0.1)  # graph input
translate = Geometry.Translate(geometry=origin, direction=ZAxis, distance=number_slider)
number_slider_2 = DoubleSlider(4.7, range=0..10 step 0.1)  # graph input
number_slider_3 = DoubleSlider(1.9, range=0..10 step 0.1)  # graph input
byPointsRadii = Cone.ByPointsRadii(startPoint=origin, endPoint=translate, startRadius=number_slider_2, endRadius=number_slider_3)
radiusRatio = Cone.RadiusRatio(cone=byPointsRadii)
