# Dynamo graph Autodesk.DesignScript.Geometry.CoordinateSystem.ByOrigin(x, y).dyn "ByOrigin" (Dynamo 2.0.1.5055)

code_block = CodeBlock { 4; }
code_block_2 = CodeBlock { 2; }
byOrigin = CoordinateSystem.ByOrigin(x=code_block, y=code_block_2)
watch = Watch(byOrigin)
