# Dynamo graph Autodesk.DesignScript.Geometry.CoordinateSystem.IsScaledOrtho.dyn "IsScaledOrtho" (Dynamo 2.0.1.5055)

code_block = CodeBlock { Vector.ByCoordinates(0,-1,2); Vector.ByCoordinates(3,2,1); }
byOriginVectors = CoordinateSystem.ByOriginVectors(xAxis=code_block.out0, yAxis=code_block.out1)
code_block_2 = CodeBlock { 0; 1; 2; 3; }
byCartesianCoordinates = Point.ByCartesianCoordinates(cs=byOriginVectors, x=code_block_2.out2, y=code_block_2.out2, z=code_block_2.out3)
code_block_3 = CodeBlock { 0; 1; 2; 3; }
byCartesianCoordinates_2 = Point.ByCartesianCoordinates(cs=byOriginVectors, x=code_block_3.out0, y=code_block_3.out1, z=code_block_3.out1)
byStartPointEndPoint = Line.ByStartPointEndPoint(startPoint=byCartesianCoordinates, endPoint=byCartesianCoordinates_2)
identity = CoordinateSystem.Identity()
code_block_4 = CodeBlock { 0; 1; 2; 3; }
byCartesianCoordinates_3 = Point.ByCartesianCoordinates(cs=identity, x=code_block_4.out2, y=code_block_4.out2, z=code_block_4.out3)
code_block_5 = CodeBlock { 0; 1; 2; 3; }
byCartesianCoordinates_4 = Point.ByCartesianCoordinates(cs=identity, x=code_block_5.out0, y=code_block_5.out1, z=code_block_5.out1)
byStartPointEndPoint_2 = Line.ByStartPointEndPoint(startPoint=byCartesianCoordinates_3, endPoint=byCartesianCoordinates_4)
isScaledOrtho = CoordinateSystem.IsScaledOrtho(coordinateSystem=identity)
watch = Watch(isScaledOrtho)
isScaledOrtho_2 = CoordinateSystem.IsScaledOrtho(coordinateSystem=byOriginVectors)
watch_2 = Watch(isScaledOrtho_2)
