# Dynamo graph Autodesk.DesignScript.Geometry.CoordinateSystem.Scale(amount).dyn (Dynamo 1.1.0.2093)

origin = Point.Origin()
byOriginVectors = CoordinateSystem.ByOriginVectors(origin=origin)
number_slider = DoubleSlider(3.5, range=0..10 step 0.1)
scale = CoordinateSystem.Scale(byOriginVectors, number_slider)
