# Dynamo graph Autodesk.DesignScript.Geometry.Curve.HorizontalFrameAtParameter.dyn "HorizontalFrameAtParameter" (Dynamo 2.0.1.5055)

code_block = CodeBlock { Circle.ByCenterPointRadius(Point.Origin(), 10); }
number_slider = DoubleSlider(0.3, range=0..1 step 0.01)  # graph input
horizontalFrameAtParameter = Curve.HorizontalFrameAtParameter(curve=code_block, param=number_slider)
