# Dynamo graph Autodesk.DesignScript.Geometry.Curve.OffsetMany.dyn (Dynamo 2.19.0.5874)

creating_points = CodeBlock { x = [-15, -14, -3, 13, 16]; y = [-12, 8, 0, 19, -15]; pnts = Point.ByCoordinates(x,y); }
boolean = BoolSelector(true)
byPoints = PolyCurve.ByPoints(points=creating_points.pnts, connectLastToFirst=boolean)
offset_distance = IntegerSlider(-6, range=-8..8 step 2)
offsetMany = Curve.OffsetMany(curve=byPoints, signedDistance=offset_distance)
