# Dynamo graph Autodesk.DesignScript.Geometry.Curve.ParameterAtPoint.dyn "ParameterAtPoint" (Dynamo 2.0.1.5055)

code_block = CodeBlock { 6; }
randomList = Math.RandomList(amount=code_block)
code_block_2 = CodeBlock(x=randomList) { x*10; }
randomList_2 = Math.RandomList(amount=code_block)
code_block_3 = CodeBlock(x=randomList_2) { x*10; }
byCoordinates = Point.ByCoordinates(x=code_block_2, y=code_block_3)
byControlPoints = NurbsCurve.ByControlPoints(points=byCoordinates)
code_block_4 = CodeBlock { 2; 1; }
byCoordinates_2 = Point.ByCoordinates(x=code_block_4.out0, y=code_block_4.out1)
parameterAtPoint = Curve.ParameterAtPoint(curve=byControlPoints, point=byCoordinates_2)
