# Dynamo graph Autodesk.DesignScript.Geometry.Curve.Simplify.dyn "Simplify" (Dynamo 2.0.1.5055)

code_block = CodeBlock { 6; }
randomList = Math.RandomList(amount=code_block)
code_block_2 = CodeBlock(x=randomList) { x*4; }
randomList_2 = Math.RandomList(amount=code_block)
code_block_3 = CodeBlock(x=randomList_2) { x*4; }
byCoordinates = Point.ByCoordinates(x=code_block_2, y=code_block_3)
byControlPoints = NurbsCurve.ByControlPoints(points=byCoordinates)
number_slider = DoubleSlider(17.1, range=0.01..100 step 0.01)  # graph input
simplify = Curve.Simplify(curve=byControlPoints, tolerance=number_slider)
code_block_4 = CodeBlock { 1..30..#20; Math.Sin(0..360..#20)*4; }
byCoordinates_2 = Point.ByCoordinates(x=code_block_4.out0, y=code_block_4.out1)
byControlPoints_2 = NurbsCurve.ByControlPoints(points=byCoordinates_2)
simplify_2 = Curve.Simplify(curve=byControlPoints_2, tolerance=number_slider)
