# Dynamo graph Autodesk.DesignScript.Geometry.Curve.SplitByPoints.dyn "SplitByPoints" (Dynamo 2.0.1.5055)

code_block = CodeBlock { 6; }
randomList = Math.RandomList(amount=code_block)
code_block_2 = CodeBlock(x=randomList) { x*10; }
sort = List.Sort(list=code_block_2)
randomList_2 = Math.RandomList(amount=code_block)
code_block_3 = CodeBlock(x=randomList_2) { x*10; }
sort_2 = List.Sort(list=code_block_3)
byCoordinates = Point.ByCoordinates(x=sort, y=sort_2)
byPoints = NurbsCurve.ByPoints(points=byCoordinates)
splitByPoints = Curve.SplitByPoints(curve=byPoints, points=byCoordinates)
