# Dynamo graph Autodesk.DesignScript.Geometry.Curve.SweepAsSurface.dyn (Dynamo 2.17.0.3255)

code_block = CodeBlock { Point.Origin(); Point.ByCoordinates(10,0,0); }
byStartPointEndPoint = Line.ByStartPointEndPoint(startPoint=code_block.out0, endPoint=code_block.out1)
code_block_2 = CodeBlock { Point.Origin(); Point.ByCoordinates(0,5,3); Point.ByCoordinates(0,10,0); }
byThreePoints = Arc.ByThreePoints(firstPoint=code_block_2.out0, secondPoint=code_block_2.out1, thirdPoint=code_block_2.out2)
bySweep = Surface.BySweep(profile=byStartPointEndPoint, path=byThreePoints)
