# Dynamo graph Autodesk.DesignScript.Geometry.Cylinder.ByPointsRadius.dyn "ByPointsRadius" (Dynamo 2.0.1.5055)

origin = Point.Origin()
top_position = DoubleSlider(0, range=-4..4 step 0.1)  # graph input
height_z = DoubleSlider(5.3, range=0.1..8 step 0.1)  # graph input
byCoordinates = Point.ByCoordinates(x=top_position, z=height_z)
radius = DoubleSlider(1.6, range=0.1..5 step 0.1)  # graph input
byPointsRadius = Cylinder.ByPointsRadius(startPoint=origin, endPoint=byCoordinates, radius=radius)
code_block = CodeBlock(geometry=byPointsRadius) { color = Color.ByARGB(100,141,198,217); GeometryColor.ByGeometryColor(geometry, color); }
