# Dynamo graph Autodesk.DesignScript.Geometry.Cylinder.Height.dyn "Height" (Dynamo 2.0.1.5055)

origin = Point.Origin()
top_position = DoubleSlider(0, range=-4..4 step 0.1)  # graph input
height_z = DoubleSlider(5.3, range=0.1..8 step 0.1)  # graph input
byCoordinates = Point.ByCoordinates(x=top_position, z=height_z)
radius = DoubleSlider(1.6, range=0.1..5 step 0.1)  # graph input
byPointsRadius = Cylinder.ByPointsRadius(startPoint=origin, endPoint=byCoordinates, radius=radius)
height = Cylinder.Height(cylinder=byPointsRadius)
