# Dynamo graph Autodesk.DesignScript.Geometry.Cylinder.Radius.dyn "Radius" (Dynamo 2.0.1.5055)

number_slider = DoubleSlider(3.1, range=0.1..4 step 0.1)  # graph input
code_block = CodeBlock { 10; }
byRadiusHeight = Cylinder.ByRadiusHeight(radius=number_slider, height=code_block)
radius = Cylinder.Radius(cylinder=byRadiusHeight)
watch = Watch(radius)
code_block_2 = CodeBlock(geometry=byRadiusHeight) { color = Color.ByARGB(100,141,198,217); GeometryColor.ByGeometryColor(geometry, color); }
