# Dynamo graph Autodesk.DesignScript.Geometry.Ellipse.ByCoordinateSystemRadii.dyn "ByCoordinateSystemRadii" (Dynamo 2.0.1.5055)

code_block = CodeBlock { 2; }
randomList = Math.RandomList(amount=code_block)
code_block_2 = CodeBlock(x=randomList) { x*12; }
code_block_3 = CodeBlock { 0; 1; }
getItemAtIndex = List.GetItemAtIndex(list=code_block_2, index=code_block_3.out0)
getItemAtIndex_2 = List.GetItemAtIndex(list=code_block_2, index=code_block_3.out1)
byOrigin = CoordinateSystem.ByOrigin(x=getItemAtIndex, y=getItemAtIndex_2)
number_slider = DoubleSlider(7.3, range=0..20 step 0.1)  # graph input
number_slider_2 = DoubleSlider(11.8, range=0..20 step 0.1)  # graph input
byCoordinateSystemRadii = Ellipse.ByCoordinateSystemRadii(origin=byOrigin, xAxisRadius=number_slider, yAxisRadius=number_slider_2)
