# Dynamo graph Autodesk.DesignScript.Geometry.Ellipse.ByOriginVectors.dyn "ByOriginVectors" (Dynamo 2.0.1.5055)

code_block = CodeBlock { 2; }
randomList = Math.RandomList(amount=code_block)
code_block_2 = CodeBlock(x=randomList) { x*12; }
code_block_3 = CodeBlock { 0; 1; }
getItemAtIndex = List.GetItemAtIndex(list=code_block_2, index=code_block_3.out0)
getItemAtIndex_2 = List.GetItemAtIndex(list=code_block_2, index=code_block_3.out1)
byCoordinates = Point.ByCoordinates(x=getItemAtIndex, y=getItemAtIndex_2)
XAxis = Vector.XAxis()
number_slider = DoubleSlider(7.3, range=0..20 step 0.1)  # graph input
scale = Vector.Scale(vector=XAxis, scale_factor=number_slider)
YAxis = Vector.YAxis()
number_slider_2 = DoubleSlider(11.8, range=0..20 step 0.1)  # graph input
scale_2 = Vector.Scale(vector=YAxis, scale_factor=number_slider_2)
byOriginVectors = Ellipse.ByOriginVectors(origin=byCoordinates, xAxisRadius=scale, yAxisRadius=scale_2)
