# Dynamo graph Autodesk.DesignScript.Geometry.Geometry.ImportFromSAT(filePath).dyn (Dynamo 2.17.0.3255)

file_path = Filename("..\..\..\..\..\..\Desktop\Export\export.sat")  # graph input
importFromSATWithUnits = Geometry.ImportFromSATWithUnits(file_filePath=file_path)
string = StringInput("C:\Users\dneno\OneDrive\Desktop\Export\export.sat")  # graph input
importFromSATWithUnits_2 = Geometry.ImportFromSATWithUnits(file_filePath=string)
