# Dynamo graph Autodesk.DesignScript.Geometry.Geometry.Intersect.dyn "Intersect" (Dynamo 2.0.1.5055)

code_block = CodeBlock { 5; 2; 8; }
byCoordinates = Point.ByCoordinates(x=code_block.out0, y=code_block.out1, z=code_block.out2)
code_block_2 = CodeBlock { 5; }
byCenterPointRadius = Sphere.ByCenterPointRadius(centerPoint=byCoordinates, radius=code_block_2)
code_block_3 = CodeBlock { 1; 2; 3; }
byCoordinates_2 = Point.ByCoordinates(x=code_block_3.out0, y=code_block_3.out1, z=code_block_3.out2)
byCenterPointRadius_2 = Sphere.ByCenterPointRadius(centerPoint=byCoordinates_2, radius=code_block_2)
doesIntersect = Geometry.DoesIntersect(geometry=byCenterPointRadius, other=byCenterPointRadius_2)
watch = Watch(doesIntersect)
intersect = Geometry.Intersect(geometry=byCenterPointRadius, other=byCenterPointRadius_2)
