# Dynamo graph Autodesk.DesignScript.Geometry.Geometry.IsAlmostEqualTo.dyn "IsAlmostEqualTo" (Dynamo 2.0.1.5055)

byRadiusHeight = Cylinder.ByRadiusHeight()
byCenterPointRadius = Circle.ByCenterPointRadius()
extrudeAsSolid = Curve.ExtrudeAsSolid(curve=byCenterPointRadius)
isAlmostEqualTo = Geometry.IsAlmostEqualTo(geometry=byRadiusHeight, other=extrudeAsSolid)
watch = Watch(isAlmostEqualTo)
x_position = DoubleSlider(0, range=0..4 step 0.1)  # graph input
height_z = DoubleSlider(1, range=1..2 step 0.1)  # graph input
code_block = CodeBlock(x=x_position, z=height_z) { Point.ByCoordinates(x,0,0); Point.ByCoordinates(x,0,z); }
byPointsRadius = Cylinder.ByPointsRadius(startPoint=code_block.out0, endPoint=code_block.out1)
isAlmostEqualTo_2 = Geometry.IsAlmostEqualTo(geometry=byPointsRadius, other=byRadiusHeight)
watch_2 = Watch(isAlmostEqualTo_2)
code_block_2 = CodeBlock(geo1=byPointsRadius, geo2=byRadiusHeight, geo3=extrudeAsSolid) { geometry = [geo1, geo2, geo3]; color = Color.ByARGB(100,141,198,217); GeometryColor.ByGeometryColor(geometry, color); }
identity = Object.Identity(obj=code_block_2.out2)
