# Dynamo graph Autodesk.DesignScript.Geometry.Geometry.Mirror.dyn "Mirror" (Dynamo 2.0.1.5055)

origin = Point.Origin()
code_block = CodeBlock { 5; 2; 8; }
byCoordinates = Point.ByCoordinates(x=code_block.out0, y=code_block.out1, z=code_block.out2)
byPointsRadius = Cone.ByPointsRadius(startPoint=origin, endPoint=byCoordinates, startRadius=code_block.out0)
YZ = Plane.YZ()
mirror = Geometry.Mirror(geometry=byPointsRadius, mirrorPlane=YZ)
