# Dynamo graph Autodesk.DesignScript.Geometry.Geometry.OrientedBoundingBox.dyn (Dynamo 2.19.4.6632)

byCenterPointRadius = Sphere.ByCenterPointRadius()
code_block = CodeBlock { 1; 2.5; 0.5; }
scale = Geometry.Scale(geometry=byCenterPointRadius, xamount=code_block.out0, yamount=code_block.out1, zamount=code_block.out2)
byCoordinates = Point.ByCoordinates()
ZAxis = Vector.ZAxis()
code_block_2 = CodeBlock { 45; }
rotate = Geometry.Rotate(geometry=scale, origin=byCoordinates, axis=ZAxis, degrees=code_block_2)
orientedBoundingBox = Geometry.OrientedBoundingBox(geometry=rotate)
toCuboid = BoundingBox.ToCuboid(boundingBox=orientedBoundingBox)
number = DoubleInput(20)
byARGB = Color.ByARGB(alpha=number)
byGeometryColor = Modifiers.GeometryColor.ByGeometryColor(geometry=toCuboid, color=byARGB)
