# Dynamo graph Autodesk.DesignScript.Geometry.Geometry.ProjectMany.dyn "Autodesk.DesignScript.Geometry.Point.Project" (Dynamo 4.1.0.2940)

number_slider = DoubleSlider(2.6, range=0..10 step 0.1)  # graph input
byCenterPointRadius = Sphere.ByCenterPointRadius(radius=number_slider)
code_block = CodeBlock { -5; -1; 2; }
byCoordinates = Point.ByCoordinates(x=code_block.out0, y=code_block.out1, z=code_block.out2)
XAxis = Vector.XAxis()
projectMany = Geometry.ProjectMany(geometry=byCenterPointRadius, points=byCoordinates, projectionDirection=XAxis)
