# Dynamo graph Autodesk.DesignScript.Geometry.Geometry.SerializeAsSAB.dyn (Dynamo 2.19.4.6632)

file_path = Filename(".\cuboidSAB.csv")
code_block = CodeBlock { 2; }
byLengths = Cuboid.ByLengths(width=code_block, length=code_block, height=code_block)
# note: Serialized Binary stream data as Integers
serializeAsSAB = Geometry.SerializeAsSAB(geometry=byLengths)
watch = Watch(serializeAsSAB)
exportCSV = Data.ExportCSV(filePath=file_path, data=watch)
