# Dynamo graph Autodesk.DesignScript.Geometry.Geometry.ToSolidDef.dyn (Dynamo 2.19.0.5874)

byLengths = Cuboid.ByLengths()
toSolidDef = Geometry.ToSolidDef(geometry=byLengths)
stringifyJSON = Data.StringifyJSON(values=toSolidDef)
# note: Right click on Watch node and "Copy Contents" to use Solid Def string representation in another graph
watch = Watch(stringifyJSON)
