# Dynamo graph Autodesk.DesignScript.Geometry.IndexGroup.ByIndices(a, b, c).dyn "ByIndices" (Dynamo 2.0.1.5055)

code_block = CodeBlock { Math.RandomList(3)*2; Math.RandomList(3)*2; Math.RandomList(3)*2; }
byCoordinates = Point.ByCoordinates(x=code_block.out0, y=code_block.out1, z=code_block.out2)
code_block_2 = CodeBlock { 0; 1; 2; }
byIndices = IndexGroup.ByIndices(a=code_block_2.out0, b=code_block_2.out1, c=code_block_2.out2)
byPointsFaceIndices = Mesh.ByPointsFaceIndices(vertexPositions=byCoordinates, indices=byIndices)
