# Dynamo graph Autodesk.DesignScript.Geometry.IndexGroup.C.dyn "C" (Dynamo 2.0.1.5055)

code_block = CodeBlock { pt1 = Point.ByCoordinates(0,2,1); pt2 = Point.ByCoordinates(2,2,3); pt3 = Point.ByCoordinates(1,1,0); [pt1, pt2, pt3]; }
code_block_2 = CodeBlock { 0; 1; 2; }
byIndices = IndexGroup.ByIndices(a=code_block_2.out0, b=code_block_2.out1, c=code_block_2.out2)
byPointsFaceIndices = Mesh.ByPointsFaceIndices(vertexPositions=code_block.out3, indices=byIndices)
C = IndexGroup.C(indexGroup=byIndices)
watch = Watch(C)
