# Dynamo graph Autodesk.DesignScript.Geometry.IndexGroup.Count.dyn "Count" (Dynamo 2.0.1.5055)

code_block = CodeBlock()
# ---------- code_block.designscript (11 lines) ----------
pt1 = Point.ByCoordinates(7, 2, 0);
pt2 = Point.ByCoordinates(5, 3, 0);
pt3 = Point.ByCoordinates(5, 1, 0);
pt4 = Point.ByCoordinates(6, 0, 0);
[pt1,pt2,pt3,pt4];
pt5 = Point.ByCoordinates(3, 2, 0);
pt6 = Point.ByCoordinates(1, 3, 0);
pt7 = Point.ByCoordinates(1, 1, 0);
[pt5,pt6,pt7];
IndexGroup.ByIndices(0,1,2,3);
IndexGroup.ByIndices(0,1,2);
# ----------------------------------------
byPointsFaceIndices = Mesh.ByPointsFaceIndices(vertexPositions=code_block.out4, indices=code_block.out9)
count = IndexGroup.Count(indexGroup=code_block.out9)
watch = Watch(count)
byPointsFaceIndices_2 = Mesh.ByPointsFaceIndices(vertexPositions=code_block.out8, indices=code_block.out10)
count_2 = IndexGroup.Count(indexGroup=code_block.out10)
watch_2 = Watch(count_2)
