# Dynamo graph Autodesk.DesignScript.Geometry.Line.ByStartPointDirectionLength.dyn "ByStartPointDirectionLength" (Dynamo 2.0.1.5055)

code_block = CodeBlock { 3; 7; 2; }
byCoordinates = Point.ByCoordinates(x=code_block.out0, y=code_block.out1, z=code_block.out2)
YAxis = Vector.YAxis()
integer_slider = IntegerSlider(3, range=3..20 step 1)  # graph input
byStartPointDirectionLength = Line.ByStartPointDirectionLength(startPoint=byCoordinates, direction=YAxis, length=integer_slider)
