# Dynamo graph Autodesk.DesignScript.Geometry.Line.ByStartPointEndPoint.dyn "ByStartPointEndPoint" (Dynamo 2.0.1.5055)

code_block = CodeBlock { 3; 7; 2; }
byCoordinates = Point.ByCoordinates(x=code_block.out0, y=code_block.out1, z=code_block.out2)
code_block_2 = CodeBlock { 1; 7; -2; }
byCoordinates_2 = Point.ByCoordinates(x=code_block_2.out0, y=code_block_2.out1, z=code_block_2.out2)
byStartPointEndPoint = Line.ByStartPointEndPoint(startPoint=byCoordinates, endPoint=byCoordinates_2)
