# Dynamo graph Autodesk.DesignScript.Geometry.Line.ByTangency.dyn "ByTangency" (Dynamo 2.0.1.5055)

code_block = CodeBlock { [0,1,2,3]; [0,1,2,6]; }
byCoordinates = Point.ByCoordinates(x=code_block.out0, y=code_block.out1)
byControlPoints = NurbsCurve.ByControlPoints(points=byCoordinates)
number_slider = DoubleSlider(0.47, range=0..2 step 0.01)  # graph input
byTangency = Line.ByTangency(curve=byControlPoints, parameter=number_slider)
