# Dynamo graph Autodesk.DesignScript.Geometry.Line.Direction.dyn "Direction" (Dynamo 2.0.1.5055)

integer_slider = IntegerSlider(13, range=3..20 step 1)  # graph input
randomList = Math.RandomList(amount=integer_slider)
code_block = CodeBlock(x=randomList) { x*2; }
randomList_2 = Math.RandomList(amount=integer_slider)
code_block_2 = CodeBlock(y=randomList_2) { y*3; }
byCoordinates = Point.ByCoordinates(x=code_block, y=code_block_2)
byBestFitThroughPoints = Line.ByBestFitThroughPoints(bestFitPoints=byCoordinates)
direction = Line.Direction(line=byBestFitThroughPoints)
