# Dynamo graph Autodesk.DesignScript.Geometry.Mesh.Area.dyn (Dynamo 2.12.0.5650)
# packages: MeshToolkit 3.0.0

code_block = CodeBlock { 10; }
code_block_2 = CodeBlock { 5; }
cone = Mesh.Cone(baseRadius=code_block, topRadius=code_block_2, height=code_block)
area = Mesh.Area(mesh=cone)
watch = Watch(area)
