# Dynamo graph Autodesk.DesignScript.Geometry.Mesh.BooleanDifference.dyn (Dynamo 2.6.1.8786)
# packages: MeshToolkit 3.0.0

code_block = CodeBlock { 15; }
cuboid = Mesh.Cuboid(length=code_block, width=code_block, height=code_block)
code_block_2 = CodeBlock { 10; }
sphere = Mesh.Sphere(radius=code_block_2)
booleanDifference = Mesh.BooleanDifference(mesh=cuboid, tool=sphere)
