# Dynamo graph Autodesk.DesignScript.Geometry.Mesh.BooleanIntersection.dyn (Dynamo 2.6.1.8786)
# packages: MeshToolkit 3.0.0

code_block = CodeBlock { 5; }
byCoordinates = Point.ByCoordinates(x=code_block, y=code_block)
code_block_2 = CodeBlock { 10; }
sphere = Mesh.Sphere(origin=byCoordinates, radius=code_block_2)
code_block_3 = CodeBlock { 5; }
byCoordinates_2 = Point.ByCoordinates(z=code_block_3)
code_block_4 = CodeBlock { 12; }
cuboid = Mesh.Cuboid(origin=byCoordinates_2, length=code_block_4, width=code_block_4, height=code_block_4)
booleanIntersection = Mesh.BooleanIntersection(mesh=sphere, tool=cuboid)
edges = Mesh.Edges(mesh=cuboid)
edges_2 = Mesh.Edges(mesh=sphere)
