# Dynamo graph Autodesk.DesignScript.Geometry.Mesh.BooleanUnion.dyn (Dynamo 2.6.1.8786)
# packages: MeshToolkit 3.0.0

code_block = CodeBlock { 7.5; }
byCoordinates = Point.ByCoordinates(z=code_block)
code_block_2 = CodeBlock { 10; }
sphere = Mesh.Sphere(origin=byCoordinates, radius=code_block_2)
code_block_3 = CodeBlock { 15; }
cuboid = Mesh.Cuboid(origin=byCoordinates, length=code_block_3, width=code_block_3, height=code_block_3)
booleanUnion = Mesh.BooleanUnion(mesh=sphere, tool=cuboid)
edges = Mesh.Edges(mesh=booleanUnion)
