# Dynamo graph Autodesk.DesignScript.Geometry.Mesh.ByGeometry.dyn "Autodesk.DesignScript.Geometry.Mesh.ByGeometry(wave)" (Dynamo 2.6.1.8786)
# packages: MeshToolkit 3.0.0

byCoordinates = Point.ByCoordinates()
integer_slider = IntegerSlider(10, range=4..15 step 1)
code_block = CodeBlock(n=integer_slider) { n; }
code_block_2 = CodeBlock(n=code_block) { 0..n-1; }
translate = Geometry.Translate(geometry=byCoordinates, xTranslation=code_block_2, yTranslation=code_block_2, lacing=CrossProduct)
code_block_3 = CodeBlock(n=code_block) { n*n; }
randomList = Math.RandomList(amount=code_block_3)
chop = List.Chop(list=randomList, lengths=code_block)
integer_slider_2 = IntegerSlider(5, range=2..15 step 1)
integer_slider_3 = IntegerSlider(7, range=4..15 step 1)
remapRange = Math.RemapRange(numbers=chop, newMin=integer_slider_2, newMax=integer_slider_3)
translate_2 = Geometry.Translate(geometry=translate, zTranslation=remapRange, lacing=Shortest)
byControlPoints = NurbsCurve.ByControlPoints(points=translate_2)
code_block_4 = CodeBlock(x=translate, n=code_block) { x[n-1][0]; x[0][0]; }
byStartPointEndPoint = Line.ByStartPointEndPoint(startPoint=code_block_4.out1, endPoint=code_block_4.out0)
byLoft = Surface.ByLoft(crossSections=byControlPoints, guideCurves=byStartPointEndPoint)
code_block_5 = CodeBlock { 40; }
byGeometry = Mesh.ByGeometry(inputGeometry=byLoft, maxGridLines=code_block_5)
triangles = Mesh.Triangles(mesh=byGeometry)
