# Dynamo graph Autodesk.DesignScript.Geometry.Mesh.ByVerticesAndIndices.dyn (Dynamo 2.13.1.3887)
# packages: MeshToolkit 3.0.0

code_block = CodeBlock()
# ---------- code_block.designscript (10 lines) ----------
point1 = Point.ByCoordinates(0, 0, 2);
point2 = Point.ByCoordinates(4, 0, 0);
point3 = Point.ByCoordinates(0, 4, 0);
point4 = Point.ByCoordinates(-4, 0, 0);
point5 = Point.ByCoordinates(0, -4, 0);
point6 = Point.ByCoordinates(-4, -4, 2);
point7 = Point.ByCoordinates(-4, 4, 2);
point8 = Point.ByCoordinates(4, 4, 2);
point9 = Point.ByCoordinates(4, -4, 2);
t1 = [point1, point2, point3, point4, point5, point6, point7, point8, point9];
# ----------------------------------------
code_block_2 = CodeBlock { faceIndices = [ 0, 1, 2, 0, 2, 3, 0, 3, 4, 0, 1, 4, 3, 4, 5 , 2, 3, 6, 1, 2, 7, 1, 4,8, 5, 6, 3, 2, 6,7, 1, 7,8, 4, 8, 5]; }
byVerticesAndIndices = Mesh.ByVerticesAndIndices(vertices=code_block.t1, indices=code_block_2)
