# Dynamo graph Autodesk.DesignScript.Geometry.Mesh.CloseCracks.dyn (Dynamo 2.6.1.8786)
# packages: MeshToolkit 3.0.0

file_path = Filename("Example OBJ Files\stanford_bunny_tri_no_ear.obj")
importFile = Mesh.ImportFile(fileName=file_path)
edgeCount = Mesh.EdgeCount(mesh=importFile)
watch = Watch(edgeCount)
XAxis = Vector.XAxis()
code_block = CodeBlock { 300; }
translate = Mesh.Translate(mesh=importFile, vector=XAxis, distance=code_block)
closeCracks = Mesh.CloseCracks(mesh=translate)
edgeCount_2 = Mesh.EdgeCount(mesh=closeCracks)
watch_2 = Watch(edgeCount_2)
vertexPositions = Mesh.VertexPositions(mesh=importFile)
vertexNormals = Mesh.VertexNormals(mesh=importFile)
code_block_2 = CodeBlock { 5; }
byStartPointDirectionLength = Line.ByStartPointDirectionLength(startPoint=vertexPositions, direction=vertexNormals, length=code_block_2)
vertexPositions_2 = Mesh.VertexPositions(mesh=closeCracks)
vertexNormals_2 = Mesh.VertexNormals(mesh=closeCracks)
code_block_3 = CodeBlock { 5; }
byStartPointDirectionLength_2 = Line.ByStartPointDirectionLength(startPoint=vertexPositions_2, direction=vertexNormals_2, length=code_block_3)
