# Dynamo graph Autodesk.DesignScript.Geometry.Mesh.Cone.dyn (Dynamo 2.6.1.8786)
# packages: MeshToolkit 3.0.0

code_block = CodeBlock { 4; }
byCoordinates = Point.ByCoordinates(x=code_block, y=code_block)
code_block_2 = CodeBlock { 4; 2; 6; 6; }
boolean = BoolSelector(true)
cone = Mesh.Cone(origin=byCoordinates, baseRadius=code_block_2.out0, topRadius=code_block_2.out1, height=code_block_2.out2, divisions=code_block_2.out3, cap=boolean)
triangles = Mesh.Triangles(mesh=cone)
