# Dynamo graph Autodesk.DesignScript.Geometry.Mesh.Cuboid.dyn (Dynamo 2.6.1.8786)
# packages: MeshToolkit 3.0.0

code_block = CodeBlock { 0; }
byCoordinates = Point.ByCoordinates(x=code_block, y=code_block, z=code_block)
code_block_2 = CodeBlock { 4; 3; 2; }
code_block_3 = CodeBlock { 4; 3; 2; }
cuboid = Mesh.Cuboid(origin=byCoordinates, length=code_block_2.out0, width=code_block_2.out1, height=code_block_2.out2, xDivisions=code_block_3.out0, yDivisions=code_block_3.out1, zDivisions=code_block_3.out2)
triangles = Mesh.Triangles(mesh=cuboid)
