# Dynamo graph Autodesk.DesignScript.Geometry.Mesh.EdgeCount.dyn (Dynamo 2.6.1.8786)
# packages: MeshToolkit 3.0.0

number_slider = DoubleSlider(10, range=0..100 step 0.1)
number_slider_2 = DoubleSlider(0, range=0..100 step 0.1)
number_slider_3 = DoubleSlider(20, range=0..100 step 0.1)
code_block = CodeBlock { 10; }
cone = Mesh.Cone(baseRadius=number_slider, topRadius=number_slider_2, height=number_slider_3, divisions=code_block)
edgeCount = Mesh.EdgeCount(mesh=cone)
watch = Watch(edgeCount)
edges = Mesh.Edges(mesh=cone)
