# Dynamo graph Autodesk.DesignScript.Geometry.Mesh.EdgesAsSixNumbers.dyn (Dynamo 2.6.1.8786)
# packages: MeshToolkit 3.0.0

code_block = CodeBlock { 5; }
byCoordinates = Point.ByCoordinates(x=code_block, y=code_block, z=code_block)
number_slider = DoubleSlider(10, range=0..100 step 0.1)
number_slider_2 = DoubleSlider(4, range=0..100 step 0.1)
cuboid = Mesh.Cuboid(origin=byCoordinates, length=number_slider, width=number_slider, height=number_slider, xDivisions=number_slider_2, yDivisions=number_slider_2, zDivisions=number_slider_2)
edgesAsSixNumbers = Mesh.EdgesAsSixNumbers(mesh=cuboid)
watch = Watch(edgesAsSixNumbers)
code_block_2 = CodeBlock { 6; }
chop = List.Chop(list=edgesAsSixNumbers, lengths=code_block_2)
code_block_3 = CodeBlock { 0; 1; 2; 3; 4; 5; }
getItemAtIndex = List.GetItemAtIndex(list=chop@L2, index=code_block_3.out0)
getItemAtIndex_2 = List.GetItemAtIndex(list=chop@L2, index=code_block_3.out1)
getItemAtIndex_3 = List.GetItemAtIndex(list=chop@L2, index=code_block_3.out2)
byCoordinates_2 = Point.ByCoordinates(x=getItemAtIndex, y=getItemAtIndex_2, z=getItemAtIndex_3)
getItemAtIndex_4 = List.GetItemAtIndex(list=chop@L2, index=code_block_3.out3)
getItemAtIndex_5 = List.GetItemAtIndex(list=chop@L2, index=code_block_3.out4)
getItemAtIndex_6 = List.GetItemAtIndex(list=chop@L2, index=code_block_3.out5)
byCoordinates_3 = Point.ByCoordinates(x=getItemAtIndex_4, y=getItemAtIndex_5, z=getItemAtIndex_6)
byStartPointEndPoint = Line.ByStartPointEndPoint(startPoint=byCoordinates_2, endPoint=byCoordinates_3)
