# Dynamo graph Autodesk.DesignScript.Geometry.Mesh.Explode.dyn (Dynamo 2.6.1.8786)
# packages: MeshToolkit 3.0.0

code_block = CodeBlock { 10; }
code_block_2 = CodeBlock { 0; 180; }
ZAxis = Vector.ZAxis()
byCenterPointRadiusAngle = Arc.ByCenterPointRadiusAngle(radius=code_block, startAngle=code_block_2.out0, endAngle=code_block_2.out1, normal=ZAxis)
XAxis = Vector.XAxis()
code_block_3 = CodeBlock { 0; 180; }
byRevolve = Surface.ByRevolve(profile=byCenterPointRadiusAngle, axisDirection=XAxis, startAngle=code_block_3.out0, sweepAngle=code_block_3.out1)
byGeometry = Mesh.ByGeometry(inputGeometry=byRevolve)
explode = Mesh.Explode(mesh=byGeometry)
watch = Watch(explode)
triangleNormals = Mesh.TriangleNormals(mesh=explode)
code_block_4 = CodeBlock { 5; }
translate = Mesh.Translate(mesh=explode, vector=triangleNormals, distance=code_block_4)
watch_3d = Watch3D(translate)
