# Dynamo graph Autodesk.DesignScript.Geometry.Mesh.ExportMeshes.dyn (Dynamo 2.6.1.8786)
# packages: MeshToolkit 3.0.0

file_path = Filename("P:\Shared\Archilizer\Clients\Autodesk\Projects\23 - Q4\Nodes Documentation\Mesh Toolkit Graphs\MeshExport.stl")
code_block = CodeBlock()
# ---------- code_block.designscript (4 lines) ----------
[Point.ByCoordinates(0.3, 0, 7),
Point.ByCoordinates(0, 0, 7),
Point.ByCoordinates(4, 0, 0.0),
Point.ByCoordinates(0, 0, 0) ];
# ----------------------------------------
byControlPoints = NurbsCurve.ByControlPoints(points=code_block)
code_block_2 = CodeBlock { 360; }
byRevolve = Surface.ByRevolve(profile=byControlPoints, sweepAngle=code_block_2)
code_block_3 = CodeBlock { 100; }
byGeometry = Mesh.ByGeometry(inputGeometry=byRevolve, maxGridLines=code_block_3)
exportMeshes = Mesh.ExportMeshes(filename=file_path, meshes=byGeometry)
