# Dynamo graph Autodesk.DesignScript.Geometry.Mesh.GenerateSupport.dyn (Dynamo 2.6.1.8786)
# packages: MeshToolkit 3.0.0

code_block = CodeBlock { 77.5; }
byCoordinates = Point.ByCoordinates(z=code_block)
code_block_2 = CodeBlock { 15; 70; 90; }
byLengths = Cuboid.ByLengths(origin=byCoordinates, width=code_block_2.out0, length=code_block_2.out2, height=code_block_2.out0)
code_block_3 = CodeBlock { 35; }
byCoordinates_2 = Point.ByCoordinates(z=code_block_3)
byLengths_2 = Cuboid.ByLengths(origin=byCoordinates_2, width=code_block_2.out0, length=code_block_2.out0, height=code_block_2.out1)
union = Solid.Union(solid=byLengths, solid_2=byLengths_2)
byGeometry = Mesh.ByGeometry(inputGeometry=union)
code_block_4 = CodeBlock { 0.5; }
code_block_5 = CodeBlock { 10; }
code_block_6 = CodeBlock { 2.5; }
code_block_7 = CodeBlock { 5; }
code_block_8 = CodeBlock { 0.4; }
generateSupport = Mesh.GenerateSupport(mesh=byGeometry, baseHeight=code_block_4, baseDiameter=code_block_5, postDiameter=code_block_6, tipHeight=code_block_7, tipDiameter=code_block_8)
