# Dynamo graph Autodesk.DesignScript.Geometry.Mesh.Intersect.dyn (Dynamo 2.6.1.8786)
# packages: MeshToolkit 3.0.0

file_path = Filename("Example Bunny\stanford_bunny_tri.obj")
importFile = Mesh.ImportFile(fileName=file_path)
code_block = CodeBlock { 0; }
getItemAtIndex = List.GetItemAtIndex(list=importFile, index=code_block)
code_block_2 = CodeBlock { 1..49..1; }
byCoordinates = Point.ByCoordinates(z=code_block_2)
ZAxis = Vector.ZAxis()
byOriginNormal = Plane.ByOriginNormal(origin=byCoordinates, normal=ZAxis)
intersect = Mesh.Intersect(mesh=getItemAtIndex, intersectionPlane=byOriginNormal)
