# Dynamo graph Autodesk.DesignScript.Geometry.Mesh.MakeWatertight.dyn "Autodesk.DesignScript.Geometry.Mesh.MakeWathertight" (Dynamo 2.6.1.8786)
# packages: MeshToolkit 3.0.0

code_block = CodeBlock()
# ---------- code_block.designscript (4 lines) ----------
[Point.ByCoordinates(1, 0, 7),
Point.ByCoordinates(0.5, 0, 7),
Point.ByCoordinates(5, 0, 0.0),
Point.ByCoordinates(0, 0, 0) ];
# ----------------------------------------
byControlPoints = NurbsCurve.ByControlPoints(points=code_block)
code_block_2 = CodeBlock { 360; }
byRevolve = Surface.ByRevolve(profile=byControlPoints, sweepAngle=code_block_2)
byGeometry = Mesh.ByGeometry(inputGeometry=byRevolve)
makeWatertight = Mesh.MakeWatertight(mesh=byGeometry)
code_block_3 = CodeBlock { 6; }
translate = Mesh.Translate(mesh=makeWatertight, x=code_block_3)
