# Dynamo graph Autodesk.DesignScript.Geometry.Mesh.Mirror.dyn (Dynamo 2.13.1.3887)
# packages: MeshToolkit 3.0.0

code_block = CodeBlock()
# ---------- code_block.designscript (4 lines) ----------
[Point.ByCoordinates(0.3, 0, 7),
Point.ByCoordinates(0, 0, 7),
Point.ByCoordinates(4, 0, 0.0),
Point.ByCoordinates(0, 0, 0) ];
# ----------------------------------------
byControlPoints = NurbsCurve.ByControlPoints(points=code_block)
code_block_2 = CodeBlock { 180; }
byRevolve = Solid.ByRevolve(profile=byControlPoints, sweepAngle=code_block_2)
byGeometry = Mesh.ByGeometry(inputGeometry=byRevolve)
code_block_3 = CodeBlock { 0; }
byCoordinates = Point.ByCoordinates(y=code_block_3)
YAxis = Vector.YAxis()
byOriginNormal = Plane.ByOriginNormal(origin=byCoordinates, normal=YAxis)
mirror = Mesh.Mirror(mesh=byGeometry, mirrorPlane=byOriginNormal)
