# Dynamo graph Autodesk.DesignScript.Geometry.Mesh.Nearest.dyn (Dynamo 3.1.0.3411)
# packages: MeshToolkit 5.0.0.7171

code_block = CodeBlock { 0; }
byCoordinates = Point.ByCoordinates(x=code_block, y=code_block, z=code_block)
code_block_2 = CodeBlock { 2; 100; }
boolean = BoolSelector(true)
sphere = Mesh.Sphere(origin=byCoordinates, radius=code_block_2.out0, divisions=code_block_2.out1, icosphere=boolean)
code_block_3 = CodeBlock { 1; 1; 3; }
byCoordinates_2 = Point.ByCoordinates(x=code_block_3.out0, y=code_block_3.out1, z=code_block_3.out2)
ZAxis = Vector.ZAxis()
reverse = Vector.Reverse(vector=ZAxis)
project = Mesh.Project(mesh=sphere, point=byCoordinates_2, dir=reverse)
byStartPointEndPoint = Line.ByStartPointEndPoint(startPoint=project, endPoint=byCoordinates_2)
nearest = Mesh.Nearest(mesh=sphere, point=byCoordinates_2)
byStartPointEndPoint_2 = Line.ByStartPointEndPoint(startPoint=nearest, endPoint=byCoordinates_2)
