# Dynamo graph Autodesk.DesignScript.Geometry.Mesh.Plane.dyn (Dynamo 2.6.1.8786)
# packages: MeshToolkit 3.0.0

code_block = CodeBlock { 2; }
byCoordinates = Point.ByCoordinates(x=code_block, y=code_block)
code_block_2 = CodeBlock { 4; 4; 8; }
plane = Mesh.Plane(origin=byCoordinates, xWidth=code_block_2.out0, yWidth=code_block_2.out0, xDivisions=code_block_2.out1, yDivisions=code_block_2.out2)
triangles = Mesh.Triangles(mesh=plane)
