# Dynamo graph Autodesk.DesignScript.Geometry.Mesh.PlaneCut.dyn "Autodesk.DesignScript.Geometry.Mesh.PlaneCut(different geometry)" (Dynamo 2.6.1.8786)
# packages: MeshToolkit 3.0.0

code_block = CodeBlock { 15; }
cuboid = Mesh.Cuboid(length=code_block, width=code_block, height=code_block)
code_block_2 = CodeBlock { 10; }
cuboid_2 = Mesh.Cuboid(length=code_block_2, width=code_block_2, height=code_block_2)
booleanDifference = Mesh.BooleanDifference(mesh=cuboid, tool=cuboid_2)
code_block_3 = CodeBlock { -1; }
byCoordinates = Vector.ByCoordinates(y=code_block_3, z=code_block_3)
byOriginNormal = Plane.ByOriginNormal(normal=byCoordinates)
boolean = BoolSelector(true)
planeCut = Mesh.PlaneCut(mesh=booleanDifference, plane=byOriginNormal, makeSolid=boolean)
