# Dynamo graph Autodesk.DesignScript.Geometry.Mesh.Reduce.dyn (Dynamo 2.6.1.8786)
# packages: MeshToolkit 3.0.0

file_path = Filename("Example Bunny\stanford_bunny_tri.obj")
importFile = Mesh.ImportFile(fileName=file_path)
triangleCount = Mesh.TriangleCount(mesh=importFile)
watch = Watch(triangleCount)
integer_slider = IntegerSlider(600, range=0..700 step 1)
reduce = Mesh.Reduce(mesh=importFile, triangleCount=integer_slider)
code_block = CodeBlock { 50; 0; 0; }
byCoordinates = Vector.ByCoordinates(x=code_block.out0, y=code_block.out1, z=code_block.out2)
translate = Mesh.Translate(mesh=reduce, vector=byCoordinates)
triangleCount_2 = Mesh.TriangleCount(mesh=translate)
watch_2 = Watch(triangleCount_2)
