# Dynamo graph Autodesk.DesignScript.Geometry.Mesh.Remesh.dyn (Dynamo 2.6.1.8786)
# packages: MeshToolkit 3.0.0

file_path = Filename("C:\Users\Daria\Downloads\toyplane_obj\toyplane.obj")
importFile = Mesh.ImportFile(fileName=file_path)
firstItem = List.FirstItem(list=importFile)
XAxis = Vector.XAxis()
code_block = CodeBlock { 90; }
rotate = Mesh.Rotate(mesh=firstItem, axis=XAxis, degrees=code_block)
edges = Mesh.Edges(mesh=rotate)
XAxis_2 = Vector.XAxis()
code_block_2 = CodeBlock { 50; }
translate = Mesh.Translate(mesh=rotate, vector=XAxis_2, distance=code_block_2)
remesh = Mesh.Remesh(mesh=translate)
edges_2 = Mesh.Edges(mesh=remesh)
