# Dynamo graph Autodesk.DesignScript.Geometry.Mesh.Repair.dyn (Dynamo 2.6.1.8786)
# packages: MeshToolkit 3.0.0

file_path = Filename(".\stanford_bunny_tri_no_ear.obj")
importFile = Mesh.ImportFile(fileName=file_path)
edges = Mesh.Edges(mesh=importFile)
repair = Mesh.Repair(mesh=importFile)
XAxis = Vector.XAxis()
code_block = CodeBlock { 50; }
translate = Mesh.Translate(mesh=repair, vector=XAxis, distance=code_block)
edges_2 = Mesh.Edges(mesh=translate)
