# Dynamo graph Autodesk.DesignScript.Geometry.Mesh.Rotate.dyn (Dynamo 2.6.1.8786)
# packages: MeshToolkit 3.0.0

file_path = Filename("Example Bunny\stanford_bunny_tri.obj")
importFile = Mesh.ImportFile(fileName=file_path)
code_block = CodeBlock { 1; }
byCoordinates = Vector.ByCoordinates(x=code_block, z=code_block)
code_block_2 = CodeBlock { 75; }
rotate = Mesh.Rotate(mesh=importFile, axis=byCoordinates, degrees=code_block_2)
