# Dynamo graph Autodesk.DesignScript.Geometry.Mesh.Scale(mesh, scaleFactor).dyn "Autodesk.DesignScript.Geometry.Mesh.Scale(scaleFactor)" (Dynamo 2.13.1.3887)
# packages: MeshToolkit 3.0.0

code_block = CodeBlock { 1; }
byCoordinates = Point.ByCoordinates(z=code_block)
code_block_2 = CodeBlock { 2; 5; }
cuboid = Mesh.Cuboid(origin=byCoordinates, length=code_block_2.out0, width=code_block_2.out0, height=code_block_2.out0, xDivisions=code_block_2.out1, yDivisions=code_block_2.out1, zDivisions=code_block_2.out1)
code_block_3 = CodeBlock { 2; }
scale = Mesh.Scale(mesh=cuboid, scaleFactor=code_block_3)
XAxis = Vector.XAxis()
code_block_4 = CodeBlock { -5; }
translate = Mesh.Translate(mesh=cuboid, vector=XAxis, distance=code_block_4)
