# Dynamo graph Autodesk.DesignScript.Geometry.Mesh.Scale(mesh, x, y, z).dyn "Autodesk.DesignScript.Geometry.Mesh.Scale(x,y,z)" (Dynamo 2.13.1.3887)
# packages: MeshToolkit 3.0.0

code_block = CodeBlock { 1; }
byCoordinates = Point.ByCoordinates(z=code_block)
code_block_2 = CodeBlock { 2; }
code_block_3 = CodeBlock { 5; }
cuboid = Mesh.Cuboid(origin=byCoordinates, length=code_block_2, width=code_block_2, height=code_block_2, xDivisions=code_block_3, yDivisions=code_block_3, zDivisions=code_block_3)
XAxis = Vector.XAxis()
code_block_4 = CodeBlock { -5; }
translate = Mesh.Translate(mesh=cuboid, vector=XAxis, distance=code_block_4)
code_block_5 = CodeBlock { 2; }
code_block_6 = CodeBlock { 3; }
code_block_7 = CodeBlock { 4; }
scale = Mesh.Scale(mesh=cuboid, x=code_block_5, y=code_block_6, z=code_block_7)
