# Dynamo graph Autodesk.DesignScript.Geometry.Mesh.Smooth.dyn (Dynamo 2.12.0.5650)
# packages: MeshToolkit 3.0.0

file_path = Filename("Example Bunny\stanford_bunny_tri.obj")
importFile = Mesh.ImportFile(fileName=file_path)
triangleCount = Mesh.TriangleCount(mesh=importFile)
code_block = CodeBlock { 5; }
smooth = Mesh.Smooth(mesh=importFile, scale=code_block)
code_block_2 = CodeBlock { 50; 0; 0; }
byCoordinates = Vector.ByCoordinates(x=code_block_2.out0, y=code_block_2.out1, z=code_block_2.out2)
translate = Mesh.Translate(mesh=smooth, vector=byCoordinates)
triangleCount_2 = Mesh.TriangleCount(mesh=translate)
