# Dynamo graph Autodesk.DesignScript.Geometry.Mesh.StrengthAnalysis.dyn "strength_analysis" (Dynamo 3.1.0.3755)
# packages: MeshToolkit 5.0.0.7127

code_block = CodeBlock { 15; }
cuboid = Mesh.Cuboid(length=code_block, width=code_block, height=code_block)
code_block_2 = CodeBlock { 10; }
sphere = Mesh.Sphere(radius=code_block_2)
booleanDifference = Mesh.BooleanDifference(mesh=cuboid, tool=sphere)
strengthAnalysis = Mesh.StrengthAnalysis(mesh=booleanDifference)
byMeshColor = Display.MeshDisplay.ByMeshColor(mesh=booleanDifference, meshColoring=strengthAnalysis)
count = List.Count(list=strengthAnalysis)
vertexCount = Mesh.VertexCount(mesh=booleanDifference)
