# Dynamo graph Autodesk.DesignScript.Geometry.Mesh.Translate(mesh, vector).dyn "Autodesk.DesignScript.Geometry.Mesh.Translate(vector)" (Dynamo 2.13.1.3887)
# packages: MeshToolkit 3.0.0

code_block = CodeBlock { 2; }
byCoordinates = Point.ByCoordinates(z=code_block)
code_block_2 = CodeBlock { 4; }
code_block_3 = CodeBlock { 8; }
cuboid = Mesh.Cuboid(origin=byCoordinates, length=code_block_2, width=code_block_2, height=code_block_2, xDivisions=code_block_3, yDivisions=code_block_3, zDivisions=code_block_3)
code_block_4 = CodeBlock { 8; 0; 0; }
byCoordinates_2 = Vector.ByCoordinates(x=code_block_4.out0, y=code_block_4.out1, z=code_block_4.out2)
translate = Mesh.Translate(mesh=cuboid, vector=byCoordinates_2)
