# Dynamo graph Autodesk.DesignScript.Geometry.Mesh.Translate(mesh, vector, distance).dyn "Autodesk.DesignScript.Geometry.Mesh.Translate(vector,distance)(with vector as line)" (Dynamo 2.6.1.8786)
# packages: MeshToolkit 3.0.0

byCoordinates = Point.ByCoordinates()
number_slider = DoubleSlider(55, range=0..100 step 5)
byCoordinates_2 = Point.ByCoordinates(x=number_slider, z=number_slider)

# group: visualize vector as line
byStartPointEndPoint = Line.ByStartPointEndPoint(startPoint=byCoordinates, endPoint=byCoordinates_2)

byCoordinates_3 = Point.ByCoordinates()
code_block = CodeBlock { 40; }
code_block_2 = CodeBlock { 3; }
cuboid = Mesh.Cuboid(origin=byCoordinates_3, length=code_block, width=code_block, height=code_block, xDivisions=code_block_2, yDivisions=code_block_2, zDivisions=code_block_2)
edges = Mesh.Edges(mesh=cuboid)
byTwoPoints = Vector.ByTwoPoints(start=byCoordinates, end=byCoordinates_2)
length = Vector.Length(vector=byTwoPoints)
translate = Mesh.Translate(mesh=cuboid, vector=byTwoPoints, distance=length)
edges_2 = Mesh.Edges(mesh=translate)
