# Dynamo graph Autodesk.DesignScript.Geometry.Mesh.TriangleCentroids.dyn (Dynamo 2.6.1.8786)
# packages: MeshToolkit 3.0.0

file_path = Filename("Example Bunny\stanford_bunny_tri.obj")
importFile = Mesh.ImportFile(fileName=file_path)
triangleCentroids = Mesh.TriangleCentroids(mesh=importFile)
triangleNormals = Mesh.TriangleNormals(mesh=importFile)
code_block = CodeBlock { 5; }
byStartPointDirectionLength = Line.ByStartPointDirectionLength(startPoint=triangleCentroids, direction=triangleNormals, length=code_block)
