# Dynamo graph Autodesk.DesignScript.Geometry.Mesh.TriangleNormals.dyn (Dynamo 2.6.1.8786)
# packages: MeshToolkit 3.0.0

file_path = Filename("Example OBJ Files\stanford_bunny_tri.obj")
importFile = Mesh.ImportFile(fileName=file_path)
triangleNormals = Mesh.TriangleNormals(mesh=importFile)
watch = Watch(triangleNormals)
triangleCentroids = Mesh.TriangleCentroids(mesh=importFile)
byStartPointDirectionLength = Line.ByStartPointDirectionLength(startPoint=triangleCentroids, direction=triangleNormals)
