# Dynamo graph Autodesk.DesignScript.Geometry.Mesh.Triangles.dyn (Dynamo 2.13.1.3887)
# packages: MeshToolkit 3.0.0

file_path = Filename("C:\Users\julit\Desktop\Dynamo\MeshToolkit\stanford_bunny_tri.obj")
importFile = Mesh.ImportFile(fileName=file_path)
triangles = Mesh.Triangles(mesh=importFile)
watch = Watch(triangles)
