# Dynamo graph Autodesk.DesignScript.Geometry.Mesh.VertexCount.dyn (Dynamo 2.6.1.8786)
# packages: MeshToolkit 3.0.0

code_block = CodeBlock { 5; }
byCoordinates = Point.ByCoordinates(x=code_block, y=code_block, z=code_block)
number_slider = DoubleSlider(10, range=0..100 step 0.1)
number_slider_2 = DoubleSlider(5, range=0..100 step 0.1)
cuboid = Mesh.Cuboid(origin=byCoordinates, length=number_slider, width=number_slider, height=number_slider, xDivisions=number_slider_2, yDivisions=number_slider_2, zDivisions=number_slider_2)
vertexCount = Mesh.VertexCount(mesh=cuboid)
watch = Watch(vertexCount)
vertexPositions = Mesh.VertexPositions(mesh=cuboid)
