# Dynamo graph Autodesk.DesignScript.Geometry.Mesh.VertexIndicesByTri.dyn (Dynamo 2.6.1.8786)
# packages: MeshToolkit 3.0.0

code_block = CodeBlock { 5; }
code_block_2 = CodeBlock { 1; }
sphere = Mesh.Sphere(radius=code_block, divisions=code_block_2)
type = Object.Type(obj=sphere)
vertexPositions = Mesh.VertexPositions(mesh=sphere)
vertexIndicesByTri = Mesh.VertexIndicesByTri(mesh=sphere)
code_block_3 = CodeBlock { 3; }
chop = List.Chop(list=vertexIndicesByTri, lengths=code_block_3)
transpose = List.Transpose(lists=chop)
code_block_4 = CodeBlock { 0; 1; 2; }
getItemAtIndex = List.GetItemAtIndex(list=transpose, index=code_block_4.out0)
getItemAtIndex_2 = List.GetItemAtIndex(list=transpose, index=code_block_4.out1)
getItemAtIndex_3 = List.GetItemAtIndex(list=transpose, index=code_block_4.out2)
byIndices = IndexGroup.ByIndices(a=getItemAtIndex, b=getItemAtIndex_2, c=getItemAtIndex_3)
byPointsFaceIndices = Mesh.ByPointsFaceIndices(vertexPositions=vertexPositions, indices=byIndices)
type_2 = Object.Type(obj=byPointsFaceIndices)
