# Dynamo graph Autodesk.DesignScript.Geometry.Mesh.VertexNormals.dyn "VertexNormals" (Dynamo 2.0.1.5055)

code_block = CodeBlock()
# ---------- code_block.designscript (5 lines) ----------
pt1 = Point.ByCoordinates(3, 2, 0);
pt2 = Point.ByCoordinates(1, 3, 0);
pt3 = Point.ByCoordinates(1, 1, 0.75);
pt4 = Point.ByCoordinates(2, 0, 1);
[pt1, pt2, pt3, pt4];
# ----------------------------------------
code_block_2 = CodeBlock { 0; 1; 2; 3; }
byIndices = IndexGroup.ByIndices(a=code_block_2.out0, b=code_block_2.out1, c=code_block_2.out2, d=code_block_2.out3)
byPointsFaceIndices = Mesh.ByPointsFaceIndices(vertexPositions=code_block.out4, indices=byIndices)
vertexNormals = Mesh.VertexNormals(mesh=byPointsFaceIndices)
byStartPointDirectionLength = Line.ByStartPointDirectionLength(startPoint=code_block.out4, direction=vertexNormals)
