# Dynamo graph Autodesk.DesignScript.Geometry.Mesh.Volume.dyn (Dynamo 2.6.1.8786)
# packages: MeshToolkit 3.0.0

number_slider = DoubleSlider(14.2, range=0..100 step 0.1)
number_slider_2 = DoubleSlider(11, range=0..100 step 0.1)
number_slider_3 = DoubleSlider(20, range=0..100 step 0.1)
boolean = BoolSelector(true)
cone = Mesh.Cone(baseRadius=number_slider, topRadius=number_slider_2, height=number_slider_3, cap=boolean)
volume = Mesh.Volume(mesh=cone)
watch = Watch(volume)
