# Dynamo graph Autodesk.DesignScript.Geometry.NurbsCurve.ByControlPoints(points).dyn "ByControlPoints" (Dynamo 2.0.1.5055)

code_block = CodeBlock { [0,1,2,3]; [0,1,2,6]; }
byCoordinates = Point.ByCoordinates(x=code_block.out0, y=code_block.out1)
byControlPoints = NurbsCurve.ByControlPoints(points=byCoordinates)
