# Dynamo graph Autodesk.DesignScript.Geometry.NurbsCurve.ByPoints(points, degree).dyn "ByPoints" (Dynamo 2.0.1.5055)

code_block = CodeBlock { 6; }
randomList = Math.RandomList(amount=code_block)
sort = List.Sort(list=randomList)
randomList_2 = Math.RandomList(amount=code_block)
sort_2 = List.Sort(list=randomList_2)
byCoordinates = Point.ByCoordinates(x=sort, y=sort_2)
code_block_2 = CodeBlock { 3; }
byPoints = NurbsCurve.ByPoints(points=byCoordinates, degree=code_block_2)
