# Dynamo graph Autodesk.DesignScript.Geometry.NurbsCurve.ByPointsTangents.dyn "ByPointsTangents" (Dynamo 2.0.1.5055)

byCenterPointRadius = Circle.ByCenterPointRadius()
code_block = CodeBlock { 0..0.5..#5; }
pointAtParameter = Curve.PointAtParameter(curve=byCenterPointRadius, param=code_block)
code_block_2 = CodeBlock { -5; 0; 0; }
byCoordinates = Vector.ByCoordinates(x=code_block_2.out0, y=code_block_2.out1, z=code_block_2.out2)
byPointsTangents = NurbsCurve.ByPointsTangents(points=pointAtParameter, startTangent=byCoordinates, endTangent=byCoordinates)
