# Dynamo graph Autodesk.DesignScript.Geometry.NurbsCurve.PeriodicControlPoints.dyn (Dynamo 4.1.0.2940)

code_block = CodeBlock()
# ---------- code_block.designscript (17 lines) ----------
[Point.ByCoordinates( 2.677775, 4.638042, 0.000000 ),
Point.ByCoordinates( 4.638042, 2.677775, 0.000000    ),
Point.ByCoordinates( 5.355550, 0.000000, 0.000000    ),
Point.ByCoordinates( 4.638042, -2.677775, 0.000000   ),
Point.ByCoordinates( 2.677775, -4.638042, 0.000000   ),
Point.ByCoordinates( 0.000000, -5.355550, 0.000000   ),
Point.ByCoordinates( -2.677775, -4.638042, 0.000000  ),
Point.ByCoordinates( -4.638042, -2.677775, 0.000000  ),
Point.ByCoordinates( -5.355550, 0.000000, 0.000000   ),
Point.ByCoordinates( -4.638042, 2.677775, 0.000000   ),
Point.ByCoordinates( -2.677775, 4.638042, 0.000000   ),
Point.ByCoordinates( 0.000000, 5.355550, 0.000000    ),
Point.ByCoordinates( 2.677775, 4.638042, 0.000000    ),
Point.ByCoordinates( 4.638042, 2.677775, 0.000000    ),
Point.ByCoordinates( 5.355550, 0.000000, 0.000000    ),
Point.ByCoordinates( 4.638042, -2.677775, 0.000000   ),
Point.ByCoordinates( 2.677775, -4.638042, 0.000000   )];
# ----------------------------------------
code_block_2 = CodeBlock()
# ---------- code_block_2.designscript (17 lines) ----------
[1.000000,
1.000000,
1.000000,
1.000000,
1.000000,
1.000000,
1.000000,
1.000000,
1.000000,
1.000000,
1.000000,
1.000000,
1.000000,
1.000000,
1.000000,
1.000000,
1.000000];
# ----------------------------------------
code_block_3 = CodeBlock()
# ---------- code_block_3.designscript (23 lines) ----------
[0.000000,
1.000000,
2.000000,
3.000000,
4.000000,
5.000000,
6.000000,
7.000000,
8.000000,
9.000000,
10.000000,
11.000000,
12.000000,
13.000000,
14.000000,
15.000000,
16.000000,
17.000000,
18.000000,
19.000000,
20.000000,
21,
22];
# ----------------------------------------
number = DoubleInput(5)
byControlPointsWeightsKnots = NurbsCurve.ByControlPointsWeightsKnots(points=code_block, weights=code_block_2, knots=code_block_3, degree=number)
controlPoints = NurbsCurve.ControlPoints(nurbsCurve=byControlPointsWeightsKnots)
watch = Watch(controlPoints)
code_block_4 = CodeBlock { 255; }
byARGB = Color.ByARGB(red=code_block_4)
byGeometryColor = Modifiers.GeometryColor.ByGeometryColor(geometry=controlPoints, color=byARGB)
isPeriodic = NurbsCurve.IsPeriodic(nurbsCurve=byControlPointsWeightsKnots)
periodicKnots = NurbsCurve.PeriodicKnots(nurbsCurve=byControlPointsWeightsKnots)
watch_2 = Watch(periodicKnots)
knots = NurbsCurve.Knots(nurbsCurve=byControlPointsWeightsKnots)
watch_3 = Watch(knots)
periodicControlPoints = NurbsCurve.PeriodicControlPoints(nurbsCurve=byControlPointsWeightsKnots)
watch_4 = Watch(periodicControlPoints)
