# Dynamo graph Autodesk.DesignScript.Geometry.NurbsCurve.PeriodicKnots.dyn "PeriodicKnots" (Dynamo 2.13.0.0)
# Example demonstrating NurbsCurve.PeriodicKnots

codeBlock = CodeBlock()
# ---------- codeBlock.designscript (10 lines) ----------
// Create control points for a periodic curve
pts = [
    Point.ByCoordinates(0, 0, 0),
    Point.ByCoordinates(10, 5, 0),
    Point.ByCoordinates(20, 0, 0),
    Point.ByCoordinates(20, -10, 0),
    Point.ByCoordinates(10, -15, 0),
    Point.ByCoordinates(0, -10, 0)
];
degree = 3;
# ----------------------------------------
codeBlock_2 = CodeBlock { true; }
byControlPoints = NurbsCurve.ByControlPoints(controlPoints=codeBlock.pts, degree=codeBlock.degree, isPeriodic=codeBlock_2)
knots = NurbsCurve.Knots(nurbsCurve=byControlPoints)
watch = Watch(knots)
periodicKnots = NurbsCurve.PeriodicKnots(nurbsCurve=byControlPoints)
watch_2 = Watch(periodicKnots)
