# Dynamo graph Autodesk.DesignScript.Geometry.NurbsSurface.ByPoints.dyn (Dynamo 1.0.1.1167)

code_block = CodeBlock { 0..25..#50; }
byCoordinates = Point.ByCoordinates(x=code_block, y=code_block, lacing=CrossProduct)
ZAxis = Vector.ZAxis()
count = Count(byCoordinates)
randomList = Math.RandomList(count)
scale = Vector.Scale(vector=ZAxis, scale_factor=randomList)
translate = Geometry.Translate(geometry=byCoordinates, direction=scale)
code_block_2 = CodeBlock { 3; 3; }
byPoints = NurbsSurface.ByPoints(translate, code_block_2.out0, code_block_2.out1)
