# Dynamo graph Autodesk.DesignScript.Geometry.NurbsSurface.ByPointsTangents.dyn (Dynamo 2.19.4.6632)

code_block = CodeBlock { xPoints = [-10,0,10]; yPoints = [-10,0]; }
byCoordinates = Point.ByCoordinates(x=code_block.xPoints, y=code_block.yPoints, lacing=CrossProduct)
code_block_2 = CodeBlock()
# ---------- code_block_2.designscript (4 lines) ----------
Vector.ByCoordinates(1, 0, 1);
Vector.ByCoordinates(1, 0, -1);
Vector.ByCoordinates(0, 1, 1);
Vector.ByCoordinates(0, 1, -1);
# ----------------------------------------
list_create = List.Create(item0=code_block_2.out2, item1=code_block_2.out3, item2=code_block_2.out2)
list_create_2 = List.Create(item0=code_block_2.out2, item1=code_block_2.out2, item2=code_block_2.out2)
list_create_3 = List.Create(item0=code_block_2.out0, item1=code_block_2.out0)
list_create_4 = List.Create(item0=code_block_2.out1, item1=code_block_2.out1)
byPointsTangents = NurbsSurface.ByPointsTangents(points=byCoordinates, startUTangents=list_create, endUTangents=list_create_2, startVTangents=list_create_3, endVTangents=list_create_4)
