# Dynamo graph Autodesk.DesignScript.Geometry.NurbsSurface.ControlPoints.dyn "ControlPoints" (Dynamo 2.0.1.5055)

code_block = CodeBlock { 4; }
randomList = Math.RandomList(amount=code_block)
code_block_2 = CodeBlock(x=randomList) { x*10; }
randomList_2 = Math.RandomList(amount=code_block)
code_block_3 = CodeBlock(x=randomList_2) { x*10; }
randomList_3 = Math.RandomList(amount=code_block)
code_block_4 = CodeBlock(x=randomList_3) { x*10; }
byCoordinates = Point.ByCoordinates(x=code_block_2, y=code_block_3, z=code_block_4)
boolean = BoolSelector(true)  # graph input
byPoints = NurbsCurve.ByPoints(points=byCoordinates, closeCurve=boolean)
byPatch = Surface.ByPatch(closedCurve=byPoints)
approximateWithTolerance = Surface.ApproximateWithTolerance(surface=byPatch)
controlPoints = NurbsSurface.ControlPoints(nurbsSurface=approximateWithTolerance)
