# Dynamo graph Autodesk.DesignScript.Geometry.NurbsSurface.IsRational.dyn "IsRational" (Dynamo 2.0.1.5055)

code_block = CodeBlock { Math.RandomList(4)*10; Math.RandomList(4)*10; Math.RandomList(4)*10; }
byCoordinates = Point.ByCoordinates(x=code_block.out0, y=code_block.out1, z=code_block.out2)
boolean = BoolSelector(true)  # graph input
byPoints = NurbsCurve.ByPoints(points=byCoordinates, closeCurve=boolean)
byPatch = Surface.ByPatch(closedCurve=byPoints)
approximateWithTolerance = Surface.ApproximateWithTolerance(surface=byPatch)
isRational = NurbsSurface.IsRational(nurbsSurface=approximateWithTolerance)
watch = Watch(isRational)
