# Dynamo graph Autodesk.DesignScript.Geometry.NurbsSurface.Weights.dyn "Weights" (Dynamo 2.0.1.5055)

code_block = CodeBlock { 0..9..#10; }
code_block_2 = CodeBlock(x=code_block) { x*2; }
code_block_3 = CodeBlock { 0..9..#20; }
code_block_4 = CodeBlock(x=code_block_3) { x*2; }
byCoordinates = Point.ByCoordinates(x=code_block_2, y=code_block_4, lacing=CrossProduct)
ZAxis = Vector.ZAxis()
count = List.Count(list=byCoordinates)
randomList = Math.RandomList(amount=count)
scale = Vector.Scale(vector=ZAxis, scale_factor=randomList)
translate = Geometry.Translate(geometry=byCoordinates, direction=scale)
byPoints = NurbsSurface.ByPoints(points=translate)
weights = NurbsSurface.Weights(nurbsSurface=byPoints)
watch = Watch(weights)
