# Dynamo graph Autodesk.DesignScript.Geometry.PanelSurface.ByCustomOrthogonalLattice.dyn (Dynamo 3.3.0.5104)

code_block = CodeBlock()
# ---------- code_block.designscript (23 lines) ----------
point00 = Point.ByCoordinates(0, 0, 0);
point01 = Point.ByCoordinates(0, 1, 1);
point02 = Point.ByCoordinates(0, 2, 1);
point03 = Point.ByCoordinates(0, 3, 0);
point04 = Point.ByCoordinates(0, 4, 0);

point10 = Point.ByCoordinates(1, 0, 0);
point11 = Point.ByCoordinates(1, 1, 1);
point12 = Point.ByCoordinates(1, 2, 1);
point13 = Point.ByCoordinates(1, 3, 0);
point14 = Point.ByCoordinates(1, 4, 0);

point20 = Point.ByCoordinates(2, 0, 0);
point21 = Point.ByCoordinates(2, 1, 1);
point22 = Point.ByCoordinates(2, 2, 1);
point23 = Point.ByCoordinates(2, 3, 0);
point24 = Point.ByCoordinates(2, 4, 0);

point30 = Point.ByCoordinates(3, 0, 0);
point31 = Point.ByCoordinates(3, 1, 1);
point32 = Point.ByCoordinates(3, 2, 1);
point33 = Point.ByCoordinates(3, 3, 0);
point34 = Point.ByCoordinates(3, 4, 0);
# ----------------------------------------
code_block_2 = CodeBlock(point00=code_block.point00, point01=code_block.point01, point02=code_block.point02, point03=code_block.point03, point04=code_block.point04, point10=code_block.point10, point11=code_block.point11, point12=code_block.point12, point13=code_block.point13, point14=code_block.point14, point20=code_block.point20, point21=code_block.point21, point22=code_block.point22, point23=code_block.point23, point24=code_block.point24, point30=code_block.point30, point31=code_block.point31, point32=code_block.point32, point33=code_block.point33, point34=code_block.point34)
# ---------- code_block_2.designscript (7 lines) ----------
points =
            [
               [point00, point01, point02, point03, point04],
               [point10, point11, point12, point13, point14],
               [point20, point21, point22, point23, point24],
               [point30, point31, point32, point33, point34]
            ];
# ----------------------------------------
number_slider = DoubleSlider(1.346, range=-0.015..100 step 0.1)
number_slider_2 = DoubleSlider(1.528, range=-0.014..100 step 0.1)
number_slider_3 = DoubleSlider(2.443, range=0..100 step 0.1)
code_block_3 = CodeBlock(t1=code_block_2, t2=number_slider, t3=number_slider_2, t4=number_slider_3)
# ---------- code_block_3.designscript (6 lines) ----------
num3 = 20;
nurbsSurface1 = NurbsSurface.ByControlPoints(t1, 2, 2);
point1 = Point.ByCoordinates(t2, t3, t4);
circle1 = Circle.ByCenterPointRadius(point1, 0.5);
vector1 = Vector.ZAxis();
geometry1 = Curve.Project(circle1, nurbsSurface1, vector1);
# ----------------------------------------
code_block_4 = CodeBlock(nurbsSurface1=code_block_3.nurbsSurface1, geometry1=code_block_3.geometry1, point1=code_block_3.point1) { geometry2 = Autodesk.Geometry.Trim(nurbsSurface1, geometry1, point1); }
code_block_5 = CodeBlock()
# ---------- code_block_5.designscript (15 lines) ----------
num1 = 1;
t1 = ((Math.Sqrt(3)) * 0.5) + 1;
uv1 = UV.ByCoordinates(0, 0);
uv2 = UV.ByCoordinates(num1, 0);
uv3 = UV.ByCoordinates(num1, num1);
uv4 = UV.ByCoordinates(0, num1);

t2 = [uv1, uv2, uv3, uv4];
uv5 = UV.ByCoordinates(0.5, num1);
uv6 = UV.ByCoordinates(1.5, num1);
uv7 = UV.ByCoordinates(num1, t1);

t3 = [uv5, uv6, uv7];

t4 = [t2, t3];
# ----------------------------------------
byCustomOrthogonalLattice = PanelSurface.ByCustomOrthogonalLattice(surface=code_block_4, numU=code_block_3.num3, numV=code_block_3.num3, uDisplacement=code_block_5.num1, vDisplacement=code_block_5.t1, tileUVs=code_block_5.t4)
