# Dynamo graph Autodesk.DesignScript.Geometry.PanelSurface.ByDiagonallySplitSquares.dyn "PanelSurface.ByDiagonallySplitSquares" (Dynamo 3.1.0.3411)

# group: Generate base surface
code_block = CodeBlock { width = 10; length = 20; }
byWidthLength = Rectangle.ByWidthLength(width=code_block.width, length=code_block.length)
byPatch = Surface.ByPatch(closedCurve=byWidthLength)

# group: Create Panels
u_number = DoubleInput(5)
v_number = DoubleInput(10)
# note: Flips the diagonally split for the Diagonally Split Squares 180 degrees
boolean = BoolSelector(false)
byDiagonallySplitSquares = PanelSurface.ByDiagonallySplitSquares(surface=byPatch, numU=u_number, numV=v_number, alternativeDiagonal=boolean)

# group: Convert Panels to Surfaces
getPanelPolygon = PanelSurface.GetPanelPolygon(panelSurface=byDiagonallySplitSquares)
