# Dynamo graph Autodesk.DesignScript.Geometry.PanelSurface.ByDiamonds.dyn "PanelSurface.ByDiamonds" (Dynamo 3.1.0.3411)

# group: Generate base surface
code_block = CodeBlock { width = 10; length = 20; }
byWidthLength = Rectangle.ByWidthLength(width=code_block.width, length=code_block.length)
byPatch = Surface.ByPatch(closedCurve=byWidthLength)

# group: Create Panels
u_number = DoubleInput(5)
v_number = DoubleInput(10)
byDiamonds = PanelSurface.ByDiamonds(surface=byPatch, numU=u_number, numV=v_number)

# group: Convert Panels to Surfaces
getPanelPolygon = PanelSurface.GetPanelPolygon(panelSurface=byDiamonds)
