# Dynamo graph Autodesk.DesignScript.Geometry.PanelSurface.ByStaggeredQuads.dyn "PanelSurface.ByStaggeredQuads" (Dynamo 3.1.0.3411)

# group: Generate base surface
code_block = CodeBlock { width = 10; length = 20; }
byWidthLength = Rectangle.ByWidthLength(width=code_block.width, length=code_block.length)
byPatch = Surface.ByPatch(closedCurve=byWidthLength)

# group: Create Panels
u_number = DoubleInput(5)
v_number = DoubleInput(10)
# note: Orient the splitting of the Staggered Quads either vertically or horizontally
boolean = BoolSelector(false)
# note: How much each line is displaced from each other, ranging from 0 (No displacement) to 1 (One full quad displacement)
displacement_factor = DoubleSlider(0.7, range=0..1 step 0.05)
byStaggeredQuads = PanelSurface.ByStaggeredQuads(surface=byPatch, numU=u_number, numV=v_number, staggerVertically=boolean, displacementFactor=displacement_factor)

# group: Convert Panels to Surfaces
getPanelPolygon = PanelSurface.GetPanelPolygon(panelSurface=byStaggeredQuads)
