# Dynamo graph Autodesk.DesignScript.Geometry.PanelSurface.GetPanelPoints.dyn "PanelSurface.GetPanelPoints" (Dynamo 3.1.0.3411)

# group: Generate base surface
code_block = CodeBlock { width = 10; length = 20; }
byWidthLength = Rectangle.ByWidthLength(width=code_block.width, length=code_block.length)
byPatch = Surface.ByPatch(closedCurve=byWidthLength)

# group: Create Panels
u_number = DoubleInput(5)
v_number = DoubleInput(10)
byQuads = PanelSurface.ByQuads(surface=byPatch, numU=u_number, numV=v_number)

# group: Taking every second Panel
numPanels = PanelSurface.NumPanels(panelSurface=byQuads)
range = Range(end=numPanels)
number = DoubleInput(2)
takeEveryNthItem = List.TakeEveryNthItem(list=range, n=number)

# group: Get selected Panels
getPanelPoints = PanelSurface.GetPanelPoints(panelSurface=byQuads, panelIndices=takeEveryNthItem)
boolean = BoolSelector(true)
byPoints = PolyCurve.ByPoints(points=getPanelPoints, connectLastToFirst=boolean)
