# Dynamo graph Autodesk.DesignScript.Geometry.PanelSurface.GetVertexIndex.dyn "PanelSurface.GetVertexIndex" (Dynamo 3.1.0.3411)

# group: Generate base surface
code_block = CodeBlock { width = 10; length = 20; }
byWidthLength = Rectangle.ByWidthLength(width=code_block.width, length=code_block.length)
byPatch = Surface.ByPatch(closedCurve=byWidthLength)

# group: Create Panels
u_number = DoubleInput(5)
v_number = DoubleInput(10)
byQuads = PanelSurface.ByQuads(surface=byPatch, numU=u_number, numV=v_number)

# group: Get selected vertices
panel_range = IntegerSlider(3, range=0..50 step 1)
numVertices = PanelSurface.NumVertices(panelSurface=byQuads)
code_block_2 = CodeBlock(number=panel_range, intCount=numVertices)
# ---------- code_block_2.designscript (4 lines) ----------
// Starting a range from zero until
// a chosen number of Vertices
panelCount = number > intCount ? intCount : number;
panelIndexRange = 0..panelCount-1;
# ----------------------------------------
getVertexIndex = PanelSurface.GetVertexIndex(panelSurface=byQuads, panelIndex=code_block_2.panelIndexRange, vertexNumber=code_block_2.panelIndexRange)
watch = Watch(getVertexIndex)
