# Dynamo graph Autodesk.DesignScript.Geometry.PanelSurface.SetTransform.dyn "Autodesk.DesignScript.Geometry.PanelSurface.ByCustomOrthogonalLattice" (Dynamo 3.3.0.5104)

code_block = CodeBlock { cylinder = Cylinder.ByRadiusHeight(CoordinateSystem.ByOrigin(0, 0, 0), 5, 10); explodedCyl = cylinder.Explode(); }
boolean = BoolSelector(true)
code_block_2 = CodeBlock(explodedCyl=code_block.explodedCyl, x=boolean) { PanelSurface.ByDiagonallySplitSquares(explodedCyl[0], 10, 10, x); }
code_block_3 = CodeBlock { point1 = Point.ByCoordinates(0, 0); 10; }
setTransform = PanelSurface.SetTransform(panelSurface=code_block_2, rotation=code_block_3.out1, rotationPoint=code_block_3.point1)
