# Dynamo graph Autodesk.DesignScript.Geometry.PanelSurfaceBoundaryCondition.Keep.dyn "PanelSurfaceBoundaryCondition.Keep" (Dynamo 3.1.0.3411)

# group: Generate base surface
code_block = CodeBlock { width = 10; length = 20; }
byWidthLength = Rectangle.ByWidthLength(width=code_block.width, length=code_block.length)
byPatch = Surface.ByPatch(closedCurve=byWidthLength)

# group: Create Panels
u_number = DoubleInput(5)
v_number = DoubleInput(10)
keep = PanelSurfaceBoundaryCondition.Keep()
byRhombiTriHexagonals = PanelSurface.ByRhombiTriHexagonals(surface=byPatch, numU=u_number, numV=v_number, boundaryCondition=keep)

# group: Convert Panels to Surfaces
getPanelPolygon = PanelSurface.GetPanelPolygon(panelSurface=byRhombiTriHexagonals)
