# Dynamo graph Autodesk.DesignScript.Geometry.PanelSurfaceBoundaryCondition.Remove.dyn "PanelSurfaceBoundaryCondition.Remove" (Dynamo 3.1.0.3411)

# group: Generate base surface
code_block = CodeBlock { width = 10; length = 20; }
byWidthLength = Rectangle.ByWidthLength(width=code_block.width, length=code_block.length)
byPatch = Surface.ByPatch(closedCurve=byWidthLength)

# group: Create Panels
u_number = DoubleInput(5)
v_number = DoubleInput(10)
# note: Orient the splitting of the Diamonds either vertically or horizontally
boolean = BoolSelector(true)
remove = PanelSurfaceBoundaryCondition.Remove()
bySplitDiamonds = PanelSurface.BySplitDiamonds(surface=byPatch, numU=u_number, numV=v_number, splitHorizontally=boolean, boundaryCondition=remove)

# group: Convert Panels to Surfaces
getPanelPolygon = PanelSurface.GetPanelPolygon(panelSurface=bySplitDiamonds)
