# Dynamo graph Autodesk.DesignScript.Geometry.Plane.ByOriginNormal.dyn "ByOriginNormal" (Dynamo 2.0.1.5055)

code_block = CodeBlock { 5; 1; -3; }
byCoordinates = Point.ByCoordinates(x=code_block.out0, y=code_block.out1, z=code_block.out2)
YAxis = Vector.YAxis()
byOriginNormal = Plane.ByOriginNormal(origin=byCoordinates, normal=YAxis)
