# Dynamo graph Autodesk.DesignScript.Geometry.Plane.ByOriginXAxisYAxis.dyn "ByOriginXAxisYAxis" (Dynamo 2.0.1.5055)

code_block = CodeBlock { 5; 1; -3; }
byCoordinates = Point.ByCoordinates(x=code_block.out0, y=code_block.out1, z=code_block.out2)
YAxis = Vector.YAxis()
code_block_2 = CodeBlock { 1; -3; 2; }
byCoordinates_2 = Vector.ByCoordinates(x=code_block_2.out0, y=code_block_2.out1, z=code_block_2.out2)
byOriginXAxisYAxis = Plane.ByOriginXAxisYAxis(origin=byCoordinates, xAxis=YAxis, yAxis=byCoordinates_2)
