# Dynamo graph Autodesk.DesignScript.Geometry.Point.Add.dyn "Add" (Dynamo 2.0.1.5055)

code_block = CodeBlock { 1; 5; 1; }
byCoordinates = Point.ByCoordinates(x=code_block.out0, y=code_block.out1, z=code_block.out2)
XAxis = Vector.XAxis()
add = Point.Add(point=byCoordinates, vectorToAdd=XAxis)
