# Dynamo graph Autodesk.DesignScript.Geometry.Point.AsVector.dyn "AsVector" (Dynamo 2.0.1.5055)

code_block = CodeBlock { 1; 5; 1; }
byCoordinates = Point.ByCoordinates(x=code_block.out0, y=code_block.out1, z=code_block.out2)
byOrigin = CoordinateSystem.ByOrigin(origin=byCoordinates)
number_slider = DoubleSlider(90, range=0..360 step 30)  # graph input
number_slider_2 = DoubleSlider(70, range=0..180 step 10)  # graph input
number_slider_3 = DoubleSlider(8, range=0..10 step 1)  # graph input
bySphericalCoordinates = Point.BySphericalCoordinates(cs=byOrigin, phi=number_slider, theta=number_slider_2, radius=number_slider_3, lacing=CrossProduct)
asVector = Point.AsVector(point=bySphericalCoordinates)
