# Dynamo graph Autodesk.DesignScript.Geometry.Point.ByCartesianCoordinates.dyn "ByCartesianCoordinates" (Dynamo 2.0.1.5055)

origin = Point.Origin()
XAxis = Vector.XAxis()
ZAxis = Vector.ZAxis()
YAxis = Vector.YAxis()
byOriginVectors = CoordinateSystem.ByOriginVectors(origin=origin, xAxis=XAxis, yAxis=ZAxis, zAxis=YAxis)
number_slider = DoubleSlider(2, range=0..10 step 1)  # graph input
number_slider_2 = DoubleSlider(4, range=1..10 step 1)  # graph input
number_slider_3 = DoubleSlider(3, range=0..10 step 1)  # graph input
code_block = CodeBlock(a=number_slider, b=number_slider_2, c=number_slider_3) { 0..a..1; 0..10..#b; 0..c..1; }
byCartesianCoordinates = Point.ByCartesianCoordinates(cs=byOriginVectors, x=code_block.out0, y=code_block.out1, z=code_block.out2, lacing=CrossProduct)
