# Dynamo graph Autodesk.DesignScript.Geometry.Point.PruneDuplicates.dyn "PruneDuplicates" (Dynamo 2.0.1.5055)

integer_slider = IntegerSlider(38, range=0..100 step 1)  # graph input
randomList = Math.RandomList(amount=integer_slider)
code_block = CodeBlock(x=randomList) { x*9; }
randomList_2 = Math.RandomList(amount=integer_slider)
code_block_2 = CodeBlock(x=randomList_2) { x*9; }
byCoordinates = Point.ByCoordinates(x=code_block, y=code_block_2)
code_block_3 = CodeBlock { 1; }
pruneDuplicates = Point.PruneDuplicates(points=byCoordinates, tolerance=code_block_3)
