# Dynamo graph Autodesk.DesignScript.Geometry.PolyCurve.ByThickeningCurveNormal.dyn "PolyCurve.ByThickeningCurveNormal" (Dynamo 2.14.0.4641)

byCoordinates = Point.ByCoordinates()
number_slider = DoubleSlider(8.832, range=0..100 step 0.1)
number_slider_2 = DoubleSlider(8.872, range=0..100 step 0.1)
byCoordinates_2 = Point.ByCoordinates(x=number_slider, z=number_slider_2)
number_slider_3 = DoubleSlider(29.577, range=0..100 step 0.1)
number_slider_4 = DoubleSlider(5.197, range=0..100 step 0.1)
byCoordinates_3 = Point.ByCoordinates(x=number_slider_3, y=number_slider_4)
list_create = List.Create(item0=byCoordinates, item1=byCoordinates_2, item2=byCoordinates_3)
byPoints = PolyCurve.ByPoints(points=list_create)
code_block = CodeBlock { 12; }
byThickeningCurveNormal = PolyCurve.ByThickeningCurveNormal(curve=byPoints, thickness=code_block)
list_create_2 = List.Create(item0=byPoints, item1=byThickeningCurveNormal)
watch_3d = Watch3D(list_create_2)
