# Dynamo graph Autodesk.DesignScript.Geometry.PolyCurve.CloseWithLine.dyn "CloseWithLine" (Dynamo 2.0.1.5055)

integer_slider = IntegerSlider(4, range=0..20 step 1)  # graph input
randomList = Math.RandomList(amount=integer_slider)
code_block = CodeBlock(x=randomList) { x*10; }
randomList_2 = Math.RandomList(amount=integer_slider)
code_block_2 = CodeBlock(x=randomList_2) { x*10; }
randomList_3 = Math.RandomList(amount=integer_slider)
code_block_3 = CodeBlock(x=randomList_3) { x*10; }
byCoordinates = Point.ByCoordinates(x=code_block, y=code_block_2, z=code_block_3)
boolean = BoolSelector(false)  # graph input
byPoints = PolyCurve.ByPoints(points=byCoordinates, connectLastToFirst=boolean)
closeWithLine = PolyCurve.CloseWithLine(polyCurve=byPoints)
