# Dynamo graph Autodesk.DesignScript.Geometry.PolySurface.ByJoinedSurfaces.dyn "ByJoinedSurfaces" (Dynamo 2.0.1.5055)

origin = Point.Origin()
byCenterPointRadius = Circle.ByCenterPointRadius(centerPoint=origin)
code_block = CodeBlock { 3; }
extrude = Curve.Extrude(curve=byCenterPointRadius, distance=code_block)
byCoordinates = Point.ByCoordinates(z=code_block)
byCenterPointRadius_2 = Circle.ByCenterPointRadius(centerPoint=byCoordinates)
create = List.Create(item0=byCenterPointRadius, item1=byCenterPointRadius_2)
byPatch = Surface.ByPatch(closedCurve=create)
create_2 = List.Create(item0=extrude, item1=byPatch)
byJoinedSurfaces = PolySurface.ByJoinedSurfaces(surfaces=create_2)
