# Dynamo graph Autodesk.DesignScript.Geometry.PolySurface.ByLoftGuides.dyn (Dynamo 2.17.0.3255)

code_block = CodeBlock { 4; }
byCoordinates = Point.ByCoordinates(z=code_block)
code_block_2 = CodeBlock { 4; }
code_block_3 = CodeBlock { 90; }
code_block_4 = CodeBlock { 270; }
XAxis = Vector.XAxis()
byCenterPointRadiusAngle = Arc.ByCenterPointRadiusAngle(center=byCoordinates, radius=code_block_2, startAngle=code_block_3, endAngle=code_block_4, normal=XAxis)
code_block_5 = CodeBlock { 8; }
number_slider = DoubleSlider(-2.2, range=-10..10 step 0.1)  # graph input
byCoordinates_2 = Point.ByCoordinates(x=code_block_5, y=number_slider, z=code_block)
byCenterPointRadiusAngle_2 = Arc.ByCenterPointRadiusAngle(center=byCoordinates_2, radius=code_block_2, startAngle=code_block_3, endAngle=code_block_4, normal=XAxis)
code_block_6 = CodeBlock { 16; }
byCoordinates_3 = Point.ByCoordinates(x=code_block_6, z=code_block)
byCenterPointRadiusAngle_3 = Arc.ByCenterPointRadiusAngle(center=byCoordinates_3, radius=code_block_2, startAngle=code_block_3, endAngle=code_block_4, normal=XAxis)
create = List.Create(item0=byCenterPointRadiusAngle, item1=byCenterPointRadiusAngle_2, item2=byCenterPointRadiusAngle_3)
endPoint = Curve.EndPoint(curve=create)
code_block_7 = CodeBlock(x=endPoint) { x[0]; x[1]; x[2]; }
byThreePoints = Arc.ByThreePoints(firstPoint=code_block_7.out0, secondPoint=code_block_7.out1, thirdPoint=code_block_7.out2)
byLoftGuides = PolySurface.ByLoftGuides(crossSections=create, guideCurves=byThreePoints)
