# Dynamo graph Autodesk.DesignScript.Geometry.PolySurface.BySolid.dyn "BySolid" (Dynamo 2.0.1.5055)

code_block = CodeBlock { 5; }
byCenterPointRadius = Circle.ByCenterPointRadius(radius=code_block)
code_block_2 = CodeBlock { 6; }
regularPolygon = Polygon.RegularPolygon(circle=byCenterPointRadius, numberSides=code_block_2)
code_block_3 = CodeBlock { 3; }
extrudeAsSolid = Curve.ExtrudeAsSolid(curve=regularPolygon, distance=code_block_3)
bySolid = PolySurface.BySolid(solid=extrudeAsSolid)
code_block_4 = CodeBlock { c1 = Color.ByARGB(200,227,136,200); c2 = Color.ByARGB(200,100,136,200); [c1, c2]; }
bySurfaceColors = Modifiers.GeometryColor.BySurfaceColors(surface=bySolid, colors=code_block_4.out2)
