# Dynamo graph Autodesk.DesignScript.Geometry.PolySurface.BySweep.dyn (Dynamo 2.19.4.6632)

code_block = CodeBlock { Point.ByCoordinates(2, 0, 4); Point.ByCoordinates(4, 0, 0); Point.ByCoordinates(4, 0, 8); }
byCenterPointStartPointEndPoint = Arc.ByCenterPointStartPointEndPoint(centerPoint=code_block.out0, startPoint=code_block.out1, endPoint=code_block.out2)
origin = Point.Origin()
code_block_2 = CodeBlock { 4; 0; 120; }
ZAxis = Vector.ZAxis()
byCenterPointRadiusAngle = Arc.ByCenterPointRadiusAngle(center=origin, radius=code_block_2.out0, startAngle=code_block_2.out1, endAngle=code_block_2.out2, normal=ZAxis)
bySweep = PolySurface.BySweep(rail=byCenterPointStartPointEndPoint, crossSection=byCenterPointRadiusAngle)
