# Dynamo graph Autodesk.DesignScript.Geometry.PolySurface.Chamfer.dyn (Dynamo 2.19.4.6632)

origin = Point.Origin()
code_block = CodeBlock { 4; }
byCenterPointRadius = Circle.ByCenterPointRadius(centerPoint=origin, radius=code_block)
extrudeAsSolid = Curve.ExtrudeAsSolid(curve=byCenterPointRadius, distance=code_block)
explode = Geometry.Explode(geometry=extrudeAsSolid)
byJoinedSurfaces = PolySurface.ByJoinedSurfaces(surfaces=explode)
edges = Topology.Edges(topology=extrudeAsSolid)
code_block_2 = CodeBlock { 0.5; }
chamfer = PolySurface.Chamfer(polySurface=byJoinedSurfaces, edges=edges, offset=code_block_2)
