# Dynamo graph Autodesk.DesignScript.Geometry.PolySurface.LocateSurfacesByLine.dyn (Dynamo 2.19.4.6632)

code_block = CodeBlock { 3; }
byCenterPointRadius = Circle.ByCenterPointRadius(radius=code_block)
code_block_2 = CodeBlock { 6; }
regularPolygon = Polygon.RegularPolygon(circle=byCenterPointRadius, numberSides=code_block_2)
extrudeAsSolid = Curve.ExtrudeAsSolid(curve=regularPolygon, distance=code_block_2)
bySolid = PolySurface.BySolid(solid=extrudeAsSolid)
code_block_3 = CodeBlock { Point.ByCoordinates(6,-6,3); Vector.ByCoordinates(-6,6,0); 20; }
byStartPointDirectionLength = Line.ByStartPointDirectionLength(startPoint=code_block_3.out0, direction=code_block_3.out1, length=code_block_3.out2)
locateSurfacesByLine = PolySurface.LocateSurfacesByLine(polySurface=bySolid, line=byStartPointDirectionLength)
watch = Watch(locateSurfacesByLine)
color_palette = ColorPalette({R: 161, G: 196, B: 208, A: 255})
byGeometryColor = Modifiers.GeometryColor.ByGeometryColor(geometry=bySolid, color=color_palette)
