# Dynamo graph Autodesk.DesignScript.Geometry.PolySurface.LocateSurfacesByPoint.dyn (Dynamo 2.19.4.6632)

code_block = CodeBlock { 3; }
byCenterPointRadius = Circle.ByCenterPointRadius(radius=code_block)
code_block_2 = CodeBlock { 6; }
regularPolygon = Polygon.RegularPolygon(circle=byCenterPointRadius, numberSides=code_block_2)
extrudeAsSolid = Curve.ExtrudeAsSolid(curve=regularPolygon, distance=code_block_2)
bySolid = PolySurface.BySolid(solid=extrudeAsSolid)
code_block_3 = CodeBlock { Point.ByCoordinates(-6,1,1); Vector.ByCoordinates(1,0,0.5); }
locateSurfacesByPoint = PolySurface.LocateSurfacesByPoint(polySurface=bySolid, point=code_block_3.out0, direction=code_block_3.out1)
watch = Watch(locateSurfacesByPoint)
byStartPointDirectionLength = Line.ByStartPointDirectionLength(startPoint=code_block_3.out0, direction=code_block_3.out1)
color_palette = ColorPalette({R: 143, G: 189, B: 204, A: 255})
byGeometryColor = Modifiers.GeometryColor.ByGeometryColor(geometry=bySolid, color=color_palette)
