# Dynamo graph Autodesk.DesignScript.Geometry.PolySurface.SurfaceCount.dyn (Dynamo 3.4.1.7055)

number_slider = DoubleSlider(10, range=10..20 step 0.1)
byCoordinates = Point.ByCoordinates(z=number_slider)
byLengths = Cuboid.ByLengths(origin=byCoordinates, width=number_slider, length=number_slider, height=number_slider)
explode = Geometry.Explode(geometry=byLengths)
byJoinedSurfaces = PolySurface.ByJoinedSurfaces(surfaces=explode)
surfaceCount = PolySurface.SurfaceCount(polySurface=byJoinedSurfaces)
watch_3d = Watch3D(byJoinedSurfaces)
