# Dynamo graph Autodesk.DesignScript.Geometry.PolySurface.Surfaces.dyn (Dynamo 2.19.4.6632)

code_block = CodeBlock { 3; }
byCenterPointRadius = Circle.ByCenterPointRadius(radius=code_block)
code_block_2 = CodeBlock { 6; }
regularPolygon = Polygon.RegularPolygon(circle=byCenterPointRadius, numberSides=code_block_2)
extrudeAsSolid = Curve.ExtrudeAsSolid(curve=regularPolygon, distance=code_block_2)
bySolid = PolySurface.BySolid(solid=extrudeAsSolid)
surfaces = PolySurface.Surfaces(polySurface=bySolid)
watch = Watch(surfaces)
watch_2 = Watch(bySolid)
color_palette = ColorPalette({R: 178, G: 234, B: 234, A: 255})
byGeometryColor = Modifiers.GeometryColor.ByGeometryColor(geometry=surfaces, color=color_palette)
