# Dynamo graph Autodesk.DesignScript.Geometry.PolySurface.UnconnectedBoundaries.dyn (Dynamo 2.19.4.6632)

code_block = CodeBlock { Point.ByCoordinates(0,0,0); Point.ByCoordinates(0,0,6); }
create = List.Create(item0=code_block.out0, item1=code_block.out1)
code_block_2 = CodeBlock { 3; }
byCenterPointRadius = Circle.ByCenterPointRadius(centerPoint=create, radius=code_block_2)
code_block_3 = CodeBlock { 6; }
regularPolygon = Polygon.RegularPolygon(circle=byCenterPointRadius, numberSides=code_block_3)
byLoft = PolySurface.ByLoft(crossSections=regularPolygon)
unconnectedBoundaries = PolySurface.UnconnectedBoundaries(polySurface=byLoft)
color_palette = ColorPalette({R: 179, G: 223, B: 238, A: 255})
byGeometryColor = Modifiers.GeometryColor.ByGeometryColor(geometry=byLoft, color=color_palette)
