# Dynamo graph Autodesk.DesignScript.Geometry.Polygon.ContainmentTest.dyn "ContainmentTest" (Dynamo 2.0.1.5055)

number_slider = DoubleSlider(7, range=3..10 step 1)  # graph input
randomList = Math.RandomList(amount=number_slider)
sort = List.Sort(list=randomList)
code_block = CodeBlock(x=sort) { x*360; }
randomList_2 = Math.RandomList(amount=number_slider)
code_block_2 = CodeBlock(x=randomList_2) { x*5; }
byCylindricalCoordinates = Point.ByCylindricalCoordinates(angle=code_block, radius=code_block_2)
byPoints = Polygon.ByPoints(points=byCylindricalCoordinates)
code_block_3 = CodeBlock { 2; 4; }
byCoordinates = Point.ByCoordinates(x=code_block_3.out0, y=code_block_3.out1)
containmentTest = Polygon.ContainmentTest(polygon=byPoints, point=byCoordinates)
