# Dynamo graph Autodesk.DesignScript.Geometry.Polygon.RegularPolygon.dyn "RegularPolygon" (Dynamo 2.0.1.5055)

number_slider = DoubleSlider(6, range=3..10 step 1)  # graph input
randomList = Math.RandomList(amount=number_slider)
code_block = CodeBlock(x=randomList) { x*20; }
randomList_2 = Math.RandomList(amount=number_slider)
code_block_2 = CodeBlock(x=randomList_2) { x*20; }
byCoordinates = Point.ByCoordinates(x=code_block, y=code_block_2)
byBestFitThroughPoints = Circle.ByBestFitThroughPoints(points=byCoordinates)
regularPolygon = Polygon.RegularPolygon(circle=byBestFitThroughPoints, numberSides=number_slider)
number_slider_2 = DoubleSlider(4, range=3..10 step 1)  # graph input
randomList_3 = Math.RandomList(amount=number_slider_2)
code_block_3 = CodeBlock(x=randomList_3) { x*20; }
randomList_4 = Math.RandomList(amount=number_slider_2)
code_block_4 = CodeBlock(x=randomList_4) { x*20; }
byCoordinates_2 = Point.ByCoordinates(x=code_block_3, y=code_block_4)
byPoints = Polygon.ByPoints(points=byCoordinates_2)
