# Dynamo graph Autodesk.DesignScript.Geometry.Rectangle.Height.dyn "Height" (Dynamo 2.0.1.5055)

number_slider = DoubleSlider(3.7, range=1..10 step 0.1)  # graph input
byCoordinates = Point.ByCoordinates(x=number_slider, y=number_slider)
number_slider_2 = DoubleSlider(1.4, range=1..10 step 0.1)  # graph input
byCoordinates_2 = Point.ByCoordinates(x=number_slider, y=number_slider_2)
byCoordinates_3 = Point.ByCoordinates(x=number_slider_2, y=number_slider_2)
byCoordinates_4 = Point.ByCoordinates(x=number_slider_2, y=number_slider)
byCornerPoints = Rectangle.ByCornerPoints(p1=byCoordinates, p2=byCoordinates_2, p3=byCoordinates_3, p4=byCoordinates_4)
height = Rectangle.Height(rectangle=byCornerPoints)
width = Rectangle.Width(rectangle=byCornerPoints)
