# Dynamo graph Autodesk.DesignScript.Geometry.Solid.ByRuledLoft.dyn "Solid.ByRuledLoft" (Dynamo 2.13.1.3887)

code_block = CodeBlock { 0..5..#4; }
byCoordinates = Point.ByCoordinates(z=code_block)
code_block_2 = CodeBlock { 1..2..#4; }
byCenterPointRadius = Circle.ByCenterPointRadius(centerPoint=byCoordinates, radius=code_block_2)
regularPolygon = Polygon.RegularPolygon(circle=byCenterPointRadius)
byRuledLoft = Solid.ByRuledLoft(crossSections=regularPolygon)
watch_3d = Watch3D(byRuledLoft)
