# Dynamo graph Autodesk.DesignScript.Geometry.Solid.BySweep2Rails.dyn "BySweep2Rails" (Dynamo 2.0.1.5055)

code_block = CodeBlock { Point.ByCoordinates(-4,0,0); Point.ByCoordinates(-5,0,4); Vector.ZAxis(); }
byStartPointEndPointStartTangent = Arc.ByStartPointEndPointStartTangent(startPoint=code_block.out0, endPoint=code_block.out1, startTangent=code_block.out2)
code_block_2 = CodeBlock { Point.ByCoordinates(4,0,0); Point.ByCoordinates(5,0,4); Vector.ZAxis(); }
byStartPointEndPointStartTangent_2 = Arc.ByStartPointEndPointStartTangent(startPoint=code_block_2.out0, endPoint=code_block_2.out1, startTangent=code_block_2.out2)
code_block_3 = CodeBlock { 4; }
byCenterPointRadius = Circle.ByCenterPointRadius(radius=code_block_3)
bySweep2Rails = Solid.BySweep2Rails(path=byStartPointEndPointStartTangent, guideRail=byStartPointEndPointStartTangent_2, profile=byCenterPointRadius)
code_block_4 = CodeBlock(geometry=bySweep2Rails) { color = Color.ByARGB(100,141,198,217); GeometryColor.ByGeometryColor(geometry, color); }
