# Dynamo graph Autodesk.DesignScript.Geometry.Solid.Centroid.dyn "Centroid" (Dynamo 2.0.1.5055)

byCenterPointRadius = Circle.ByCenterPointRadius()
code_block = CodeBlock { 0..360..36; }
sin = Math.Sin(angle=code_block)
code_block_2 = CodeBlock { 0..10..0.5; }
translate = Geometry.Translate(geometry=byCenterPointRadius, xTranslation=sin, zTranslation=code_block_2)
byLoft = Solid.ByLoft(crossSections=translate)
centroid = Solid.Centroid(solid=byLoft)
