# Dynamo graph Autodesk.DesignScript.Geometry.Solid.Repair.dyn "Solid.Repair" (Dynamo 3.6.0.6885)

remember = Remember()  # unwired: arg0
importFromSATWithUnits = Geometry.ImportFromSATWithUnits(file_filePath=remember)
remember_2 = Remember()  # unwired: arg0
importFromSATWithUnits_2 = Geometry.ImportFromSATWithUnits(file_filePath=remember_2)
differenceAll = Solid.DifferenceAll(solid=importFromSATWithUnits, others=importFromSATWithUnits_2)
repair = Solid.Repair(solid=importFromSATWithUnits)
differenceAll_2 = Solid.DifferenceAll(solid=repair, others=importFromSATWithUnits_2)
