# Dynamo graph Autodesk.DesignScript.Geometry.Solid.Separate.dyn "Solid.Separate" (Dynamo 2.14.0.3835)

number_slider = DoubleSlider(8.2, range=0..100 step 0.1)
byLengths = Cuboid.ByLengths(width=number_slider, length=number_slider, height=number_slider)
number_slider_2 = DoubleSlider(3.604, range=0..100 step 0.1)
number_slider_3 = DoubleSlider(10, range=0..100 step 0.1)
byCoordinates = Point.ByCoordinates(x=number_slider_2, z=number_slider_3)
byLengths_2 = Cuboid.ByLengths(origin=byCoordinates, width=number_slider, length=number_slider, height=number_slider)
list_create = List.Create(item0=byLengths, item1=byLengths_2)
byUnion = Solid.ByUnion(solids=list_create)
separate = Solid.Separate(solid=byUnion)
watch_3d = Watch3D(separate)
watch = Watch(separate)
