# Dynamo graph Autodesk.DesignScript.Geometry.Solid.ThinShell.dyn "ThinShell" (Dynamo 2.0.1.5055)

number_slider = DoubleSlider(6.041, range=0..100 step 0.1)
byCoordinates = Point.ByCoordinates(z=number_slider)
code_block = CodeBlock { 10; }
byLengths = Cuboid.ByLengths(origin=byCoordinates, width=code_block, length=code_block, height=code_block)
code_block_2 = CodeBlock { 0.25; }
thinShell = Solid.ThinShell(solid=byLengths, internalFaceThickness=code_block_2, externalFaceThickness=code_block_2)
code_block_3 = CodeBlock { 12; }
byCenterPointRadius = Sphere.ByCenterPointRadius(radius=code_block_3)
difference = Solid.Difference(solid=thinShell, other=byCenterPointRadius)
