# Dynamo graph Autodesk.DesignScript.Geometry.Solid.Union.dyn "Union" (Dynamo 2.0.1.5055)

code_block = CodeBlock { 12; }
byCenterPointRadius = Sphere.ByCenterPointRadius(radius=code_block)
number_slider = DoubleSlider(6.041, range=0..100 step 0.1)
byCoordinates = Point.ByCoordinates(z=number_slider)
code_block_2 = CodeBlock { 10; }
byLengths = Cuboid.ByLengths(origin=byCoordinates, width=code_block_2, length=code_block_2, height=code_block_2)
union = Solid.Union(solid=byCenterPointRadius, solid_2=byLengths)
