# Dynamo graph Autodesk.DesignScript.Geometry.Sphere.ByFourPoints.dyn "ByFourPoints" (Dynamo 2.0.1.5055)

x_position = DoubleSlider(4.1, range=-5..10 step 0.1)  # graph input
y_position = DoubleSlider(-1.6, range=-5..10 step 0.1)  # graph input
code_block = CodeBlock(x=x_position, y=y_position)
# ---------- code_block.designscript (8 lines) ----------
pt1 = Point.ByCoordinates(0,0,0);
pt2 = Point.ByCoordinates(x,y,0);
pt3 = Point.ByCoordinates(x,y,4);
pt4 = Point.ByCoordinates(0,0,4);
pt5 = Point.ByCoordinates(8,0,0);
pt6 = Point.ByCoordinates(8,0,4);
circle1 = [pt1, pt2, pt3, pt4];
circle2 = [pt2, pt3, pt5, pt6];
# ----------------------------------------
byFourPoints = Sphere.ByFourPoints(points=code_block.circle1)
code_block_2 = CodeBlock(geometry=byFourPoints) { color = Color.ByARGB(100,141,198,217); GeometryColor.ByGeometryColor(geometry, color); }
byFourPoints_2 = Sphere.ByFourPoints(points=code_block.circle2)
code_block_3 = CodeBlock(geometry=byFourPoints_2) { color = Color.ByARGB(100,141,198,217); GeometryColor.ByGeometryColor(geometry, color); }
