# Dynamo graph Autodesk.DesignScript.Geometry.Surface.ByUnion.dyn "Surface.ByUnion" (Dynamo 2.13.1.3887)

number_slider = DoubleSlider(10, range=0..100 step 0.1)
byWidthLength = Rectangle.ByWidthLength(width=number_slider, length=number_slider)
number_slider_2 = DoubleSlider(8, range=0..100 step 0.1)
byOrigin = CoordinateSystem.ByOrigin(x=number_slider_2, y=number_slider_2)
byWidthLength_2 = Rectangle.ByWidthLength(coordinateSystem=byOrigin, width=number_slider, length=number_slider)
list_create = List.Create(item0=byWidthLength, item1=byWidthLength_2)
byPatch = Surface.ByPatch(closedCurve=list_create)
byUnion = Surface.ByUnion(surfaces=byPatch)
watch_3d = Watch3D(byUnion)
watch = Watch(byUnion)
