# Dynamo graph Autodesk.DesignScript.Geometry.Surface.ClosedInU.dyn "ClosedInU" (Dynamo 2.0.1.5055)

code_block = CodeBlock { 5; }
byCenterPointRadius = Circle.ByCenterPointRadius(radius=code_block)
code_block_2 = CodeBlock { 3; }
extrude = Curve.Extrude(curve=byCenterPointRadius, distance=code_block_2)
closedInU = Surface.ClosedInU(surface=extrude)
watch = Watch(closedInU)
