# Dynamo graph Autodesk.DesignScript.Geometry.Surface.CoordinateSystemAtParameter.dyn "CoordinateSystemAtParameter" (Dynamo 2.0.1.5055)

code_block = CodeBlock { Point.ByCoordinates(0,-1,0); Point.ByCoordinates(10,-1,0); }
byStartPointEndPoint = Line.ByStartPointEndPoint(startPoint=code_block.out0, endPoint=code_block.out1)
code_block_2 = CodeBlock { Point.ByCoordinates(0,1,0); Point.ByCoordinates(10,6,0); }
byStartPointEndPoint_2 = Line.ByStartPointEndPoint(startPoint=code_block_2.out0, endPoint=code_block_2.out1)
code_block_3 = CodeBlock { Point.ByCoordinates(0,-1,0); Point.ByCoordinates(0,0,1); Point.ByCoordinates(0,1,0); }
byThreePoints = Arc.ByThreePoints(firstPoint=code_block_3.out0, secondPoint=code_block_3.out1, thirdPoint=code_block_3.out2)
bySweep2Rails = Surface.BySweep2Rails(path=byStartPointEndPoint, guideRail=byStartPointEndPoint_2, profile=byThreePoints)
number_slider = DoubleSlider(0.54, range=0..1 step 0.01)  # graph input
number_slider_2 = DoubleSlider(0.35, range=0..1 step 0.01)  # graph input
coordinateSystemAtParameter = Surface.CoordinateSystemAtParameter(surface=bySweep2Rails, u=number_slider, v=number_slider_2)
