# Dynamo graph Autodesk.DesignScript.Geometry.Surface.Perimeter.dyn "Perimeter" (Dynamo 2.0.1.5055)

code_block = CodeBlock()
# ---------- code_block.designscript (6 lines) ----------
pt1 = Point.ByCoordinates(0,0);
pt2 = Point.ByCoordinates(8,0);
pt3 = Point.ByCoordinates(12,12);
pt4 = Point.ByCoordinates(6,6,4);
pt5 = Point.ByCoordinates(0,16,-2);
pts = [pt1,pt2,pt3,pt4, pt5];
# ----------------------------------------
boolean = BoolSelector(true)  # graph input
byControlPoints = NurbsCurve.ByControlPoints(points=code_block.pts, closeCurve=boolean)
byPatch = Surface.ByPatch(closedCurve=byControlPoints)
perimeter = Surface.Perimeter(surface=byPatch)
watch = Watch(perimeter)
