# Dynamo graph Autodesk.DesignScript.Geometry.TSpline.TSplineEdge.Info.dyn (Dynamo 2.19.0.6493)

code_block = CodeBlock { 8; 3; }
boolean = BoolSelector(true)
byAxial = TSpline.TSplineInitialSymmetry.ByAxial(xAxis=boolean, yAxis=boolean, zAxis=boolean)
boolean_2 = BoolSelector(true)
byBoxLengths = TSpline.TSplineSurface.ByBoxLengths(width=code_block.out0, length=code_block.out0, height=code_block.out0, xSpans=code_block.out1, ySpans=code_block.out1, zSpans=code_block.out1, symmetry=byAxial, inSmoothMode=boolean_2)
integer_slider = IntegerSlider(0, range=0..100 step 1)
faceByIndex = TSpline.TSplineTopology.FaceByIndex(tSplineTopology=byBoxLengths, index=integer_slider)
deleteFaces = TSpline.TSplineSurface.DeleteFaces(tSplineSurface=byBoxLengths, faces=faceByIndex)
decomposedEdges = TSpline.TSplineTopology.DecomposedEdges(tSplineTopology=deleteFaces)
info = TSpline.TSplineEdge.Info(tSplineEdge=decomposedEdges.all)
list_create = List.Create(item0=info.uvnFrame, item1=info.index, item2=info.isBorder, item3=info.isManifold)
transpose = List.Transpose(lists=list_create)
watch = Watch(transpose)
