# Dynamo graph Autodesk.DesignScript.Geometry.TSpline.TSplineEdge.IsBorder.dyn (Dynamo 2.19.0.6493)

code_block = CodeBlock { 4; 8; 10; 4; }
boolean = BoolSelector(true)
byCylinderRadiusHeight = TSpline.TSplineSurface.ByCylinderRadiusHeight(radius=code_block.out0, height=code_block.out1, radiusSpans=code_block.out2, heightSpans=code_block.out3, inSmoothMode=boolean)
XAxis = Vector.XAxis()
code_block_2 = CodeBlock { 15; }
translate = Geometry.Translate(geometry=byCylinderRadiusHeight, direction=XAxis, distance=code_block_2)
edgesCount = TSpline.TSplineTopology.EdgesCount(tSplineTopology=translate)
code_block_3 = CodeBlock(n=edgesCount) { 0..n-1; }
edgeByIndex = TSpline.TSplineTopology.EdgeByIndex(tSplineTopology=translate, index=code_block_3)
isBorder = TSpline.TSplineEdge.IsBorder(tSplineEdge=edgeByIndex)
watch = Watch(isBorder)
code_block_4 = CodeBlock { 2; }
boolean_2 = BoolSelector(true)
thicken = TSpline.TSplineSurface.Thicken(tSplineSurface=byCylinderRadiusHeight, distance=code_block_4, softEdges=boolean_2)
compressIndexes = TSpline.TSplineSurface.CompressIndexes(tSplineSurface=thicken)
edgesCount_2 = TSpline.TSplineTopology.EdgesCount(tSplineTopology=compressIndexes)
code_block_5 = CodeBlock(n=edgesCount_2) { 0..n-1; }
edgeByIndex_2 = TSpline.TSplineTopology.EdgeByIndex(tSplineTopology=compressIndexes, index=code_block_5)
isBorder_2 = TSpline.TSplineEdge.IsBorder(tSplineEdge=edgeByIndex_2)
watch_2 = Watch(isBorder_2)
filterByBoolMask = List.FilterByBoolMask(list=edgeByIndex, mask=isBorder)
UVNFrame = TSpline.TSplineEdge.UVNFrame(tSplineEdge=filterByBoolMask.in)
position = TSpline.TSplineUVNFrame.Position(tSplineUVNFrame=UVNFrame)
