# Dynamo graph Autodesk.DesignScript.Geometry.TSpline.TSplineEdge.UVNFrame.dyn (Dynamo 2.19.0.6493)

code_block = CodeBlock { 4; 8; 10; 4; }
boolean = BoolSelector(true)
byCylinderRadiusHeight = TSpline.TSplineSurface.ByCylinderRadiusHeight(radius=code_block.out0, height=code_block.out1, radiusSpans=code_block.out2, heightSpans=code_block.out3, inSmoothMode=boolean)
decomposedEdges = TSpline.TSplineTopology.DecomposedEdges(tSplineTopology=byCylinderRadiusHeight)
UVNFrame = TSpline.TSplineEdge.UVNFrame(tSplineEdge=decomposedEdges.border)
position = TSpline.TSplineUVNFrame.Position(tSplineUVNFrame=UVNFrame)
