# Dynamo graph Autodesk.DesignScript.Geometry.TSpline.TSplineFace.Index.dyn (Dynamo 2.19.3.6543)

number_slider = DoubleSlider(68.384, range=-2.816..100 step 0.1)
number_slider_2 = DoubleSlider(21.893, range=-14.607..148.143 step 0.1)
number_slider_3 = DoubleSlider(16.7, range=0..100 step 0.1)
byCoordinates = Point.ByCoordinates(x=number_slider, y=number_slider_2, z=number_slider_3)
code_block = CodeBlock { 5; 3; }
boolean = BoolSelector(true)
byBoxCorners = TSpline.TSplineSurface.ByBoxCorners(highPoint=byCoordinates, xSpans=code_block.out0, ySpans=code_block.out0, zSpans=code_block.out1, inSmoothMode=boolean)
regularFaces = TSpline.TSplineTopology.RegularFaces(tSplineTopology=byBoxCorners)
index = TSpline.TSplineFace.Index(tSplineFace=regularFaces)
watch = Watch(index)
