# Dynamo graph Autodesk.DesignScript.Geometry.TSpline.TSplineFace.Info.dyn (Dynamo 2.19.3.6543)

code_block = CodeBlock { 30; 20; 23; }
byCoordinates = Point.ByCoordinates(x=code_block.out0, y=code_block.out1, z=code_block.out2)
code_block_2 = CodeBlock { 3; 3; 3; }
boolean = BoolSelector(true)
byBoxCorners = TSpline.TSplineSurface.ByBoxCorners(highPoint=byCoordinates, xSpans=code_block_2.out0, ySpans=code_block_2.out1, zSpans=code_block_2.out2, inSmoothMode=boolean)
regularFaces = TSpline.TSplineTopology.RegularFaces(tSplineTopology=byBoxCorners)
number_slider = DoubleSlider(5, range=0..110 step 1)
getItemAtIndex = List.GetItemAtIndex(list=regularFaces, index=number_slider)
info = TSpline.TSplineFace.Info(tSplineFace=getItemAtIndex)
watch = Watch(info.sides)
watch_2 = Watch(info.valence)
watch_3 = Watch(info.index)
watch_4 = Watch(info.uvnFrame)
