# Dynamo graph Autodesk.DesignScript.Geometry.TSpline.TSplineFace.Sides.dyn (Dynamo 2.19.3.6543)

code_block = CodeBlock { 4; 2; }
boolean = BoolSelector(true)
byQuadballCenterRadius = TSpline.TSplineSurface.ByQuadballCenterRadius(radius=code_block.out0, spans=code_block.out1, inSmoothMode=boolean)
decomposedFaces = TSpline.TSplineTopology.DecomposedFaces(tSplineTopology=byQuadballCenterRadius)
sides = TSpline.TSplineFace.Sides(tSplineFace=decomposedFaces.all)
watch = Watch(sides)
