# Dynamo graph Autodesk.DesignScript.Geometry.TSpline.TSplineFace.Valence.dyn (Dynamo 2.19.3.6543)

code_block = CodeBlock { 8; }
byCoordinates = Point.ByCoordinates(z=code_block)
code_block_2 = CodeBlock { 4; }
boolean = BoolSelector(true)
byConePointsRadii = TSpline.TSplineSurface.ByConePointsRadii(endPoint=byCoordinates, startRadius=code_block_2, inSmoothMode=boolean)
decomposedFaces = TSpline.TSplineTopology.DecomposedFaces(tSplineTopology=byConePointsRadii)
valence = TSpline.TSplineFace.Valence(tSplineFace=decomposedFaces.all)
watch = Watch(valence)
