# Dynamo graph Autodesk.DesignScript.Geometry.TSpline.TSplineInitialSymmetry.YAxis.dyn (Dynamo 2.19.3.6543)

number_slider = DoubleSlider(35, range=0..100 step 1)
number_slider_2 = DoubleSlider(10, range=0..100 step 1)
byCoordinates = Point.ByCoordinates(x=number_slider, y=number_slider, z=number_slider_2)
code_block = CodeBlock { 3; }
code_block_2 = CodeBlock { 4; }
code_block_3 = CodeBlock { 3; }
boolean = BoolSelector(true)
boolean_2 = BoolSelector(true)
boolean_3 = BoolSelector(false)
byAxial = TSpline.TSplineInitialSymmetry.ByAxial(xAxis=boolean, yAxis=boolean_2, zAxis=boolean_3)
boolean_4 = BoolSelector(true)
byBoxCorners = TSpline.TSplineSurface.ByBoxCorners(highPoint=byCoordinates, xSpans=code_block, ySpans=code_block_2, zSpans=code_block_3, symmetry=byAxial, inSmoothMode=boolean_4)
YAxis = TSpline.TSplineInitialSymmetry.YAxis(tSplineInitialSymmetry=byAxial)
watch = Watch(YAxis)
