# Dynamo graph Autodesk.DesignScript.Geometry.TSpline.TSplineReflection.ByRadial.dyn "Autodesk.DesignScript.Geometry.TSpline.TSplineReflection.ByRadial(alternative)" (Dynamo 2.19.3.6543)

code_block = CodeBlock { point1 = Point.ByCoordinates(10, 0, 0); 2; vector1 = Vector.ByCoordinates(0, 1, 0); }
byCenterPointRadiusNormal = Circle.ByCenterPointRadiusNormal(centerPoint=code_block.point1, radius=code_block.out1, normal=code_block.vector1)
code_block_2 = CodeBlock { 10; }
code_block_3 = CodeBlock { 0; 45; }
byCenterPointRadiusAngle = Arc.ByCenterPointRadiusAngle(radius=code_block_2, startAngle=code_block_3.out0, endAngle=code_block_3.out1)
boolean = BoolSelector(false)
code_block_4 = CodeBlock { 3; 10; }
boolean_2 = BoolSelector(true)
bySweep = TSpline.TSplineSurface.BySweep(profile=byCenterPointRadiusNormal, path=byCenterPointRadiusAngle, parallel=boolean, pathSpans=code_block_4.out0, profileSpans=code_block_4.out1, inSmoothMode=boolean_2)
code_block_5 = CodeBlock { 7; }
faceByIndex = TSpline.TSplineTopology.FaceByIndex(tSplineTopology=bySweep, index=code_block_5)
code_block_6 = CodeBlock { 2; }
byCoordinates = Vector.ByCoordinates(z=code_block_6)
extrudeFaces = TSpline.TSplineSurface.ExtrudeFaces(tSplineSurface=bySweep, faces=faceByIndex, direction=byCoordinates)
XY = Plane.XY()
byRadial = TSpline.TSplineReflection.ByRadial(plane=XY)
addReflections = TSpline.TSplineSurface.AddReflections(tSplineSurface=extrudeFaces, reflections=byRadial)
XZ = Plane.XZ()
integer_slider = IntegerSlider(6, range=2..10 step 1)
integer_slider_2 = IntegerSlider(75, range=15..180 step 15)
