# Dynamo graph Autodesk.DesignScript.Geometry.TSpline.TSplineReflection.IsRadial.dyn (Dynamo 2.19.3.6543)

code_block = CodeBlock { 5; }
byOrigin = CoordinateSystem.ByOrigin(z=code_block)
code_block_2 = CodeBlock { 4; 1.5; 5; 6; }
boolean = BoolSelector(true)
byConeCoordinateSystemHeightRadii = TSpline.TSplineSurface.ByConeCoordinateSystemHeightRadii(cs=byOrigin, height=code_block_2.out0, startRadius=code_block_2.out1, endRadius=code_block_2.out2, radiusSpans=code_block_2.out3, inSmoothMode=boolean)
byCoordinates = Point.ByCoordinates(z=code_block)
byOriginNormal = Plane.ByOriginNormal(origin=byCoordinates)
byAxial = TSpline.TSplineReflection.ByAxial(plane=byOriginNormal)
boolean_2 = BoolSelector(true)
code_block_3 = CodeBlock { 1; }
addReflections = TSpline.TSplineSurface.AddReflections(tSplineSurface=byConeCoordinateSystemHeightRadii, reflections=byAxial, weldSymmetricPortions=boolean_2, weldTolerance=code_block_3)
reflections = TSpline.TSplineSurface.Reflections(tSplineSurface=addReflections)
isRadial = TSpline.TSplineReflection.IsRadial(tSplineReflection=reflections)
watch = Watch(isRadial)
