# Dynamo graph Autodesk.DesignScript.Geometry.TSpline.TSplineSurface.ByExtrude.dyn (Dynamo 2.19.3.6543)

list_of_points = CodeBlock()
# ---------- list_of_points.designscript (8 lines) ----------
pt1 = Point.ByCoordinates(-45, -20);
pt2 = Point.ByCoordinates(-42, -13);
pt3 = Point.ByCoordinates(-36, -19);
pt4 = Point.ByCoordinates(-35, -15);
pt5 = Point.ByCoordinates(-27, -18);
pt6 = Point.ByCoordinates(-20, -19);
pt7 = Point.ByCoordinates(-16, -13);
pts = [pt1, pt2, pt3, pt4, pt4, pt5, pt6, pt7];
# ----------------------------------------
byPoints = NurbsCurve.ByPoints(points=list_of_points.pts)
code_block = CodeBlock { 1; }
byCoordinates = Vector.ByCoordinates(y=code_block, z=code_block)
code_block_2 = CodeBlock { 5; 15; }
code_block_3 = CodeBlock { 5; 2; }
code_block_4 = CodeBlock { 25; }
boolean = BoolSelector(true)
boolean_2 = BoolSelector(true)
byExtrude = TSpline.TSplineSurface.ByExtrude(curve=byPoints, direction=byCoordinates, frontDistance=code_block_2.out0, backDistance=code_block_2.out1, frontSpans=code_block_3.out0, backSpans=code_block_3.out1, profileSpans=code_block_4, uniform=boolean, inSmoothMode=boolean_2)
