# Dynamo graph Autodesk.DesignScript.Geometry.TSpline.TSplineSurface.ByRevolve.dyn (Dynamo 2.19.3.6543)

number_slider = DoubleSlider(10, range=0..100 step 0.1)
byCoordinates = Point.ByCoordinates(y=number_slider)
number_slider_2 = DoubleSlider(10, range=0..100 step 0.1)
number_slider_3 = DoubleSlider(5, range=-1.095..100 step 0.1)
byCoordinates_2 = Point.ByCoordinates(y=number_slider_2, z=number_slider_3)
number_slider_4 = DoubleSlider(45, range=0..100 step 0.1)
number_slider_5 = DoubleSlider(38, range=-37.21..100 step 0.1)
byCoordinates_3 = Point.ByCoordinates(y=number_slider_4, z=number_slider_5)
join = List.Join(list0=byCoordinates, list1=byCoordinates_2, list2=byCoordinates_3)
byPoints = NurbsCurve.ByPoints(points=join)
code_block = CodeBlock { 0; }
byCoordinates_4 = Point.ByCoordinates(x=code_block, y=code_block)
ZAxis = Vector.ZAxis()
code_block_2 = CodeBlock { 45; 180; 10; 6; }
boolean = BoolSelector(false)
boolean_2 = BoolSelector(true)
boolean_3 = BoolSelector(false)
boolean_4 = BoolSelector(true)
byAxial = TSpline.TSplineInitialSymmetry.ByAxial(xAxis=boolean_2, yAxis=boolean_3, zAxis=boolean_4)
boolean_5 = BoolSelector(true)
byRevolve = TSpline.TSplineSurface.ByRevolve(profile=byPoints, axisOrigin=byCoordinates_4, axisDirection=ZAxis, startAngle=code_block_2.out0, sweepAngle=code_block_2.out1, radialSpans=code_block_2.out2, axialSpans=code_block_2.out3, uniform=boolean, symmetry=byAxial, inSmoothMode=boolean_5)
