# Dynamo graph Autodesk.DesignScript.Geometry.TSpline.TSplineSurface.DeleteEdges.dyn "Autodesk.Dynamo.Geometry.TSpline.TSplineSurface.DeleteEdges" (Dynamo 2.19.3.6543)

code_block = CodeBlock { 5; 20; 3; }
boolean = BoolSelector(true)
byQuadballCenterRadius = TSpline.TSplineSurface.ByQuadballCenterRadius(radius=code_block.out1, spans=code_block.out2, inSmoothMode=boolean)
code_block_2 = CodeBlock { [5,6,7]; }
edgeByIndex = TSpline.TSplineTopology.EdgeByIndex(tSplineTopology=byQuadballCenterRadius, index=code_block_2)
deleteEdges = TSpline.TSplineSurface.DeleteEdges(tSplineSurface=byQuadballCenterRadius, edges=edgeByIndex)
