# Dynamo graph Autodesk.DesignScript.Geometry.TSpline.TSplineSurface.ExportToTSS.dyn (Dynamo 2.19.3.6543)

code_block = CodeBlock()
# ---------- code_block.designscript (6 lines) ----------
point1 = Point.ByCoordinates(0, 0, 0);
point2 = Point.ByCoordinates(2, 0, 0);
point3 = Point.ByCoordinates(4, 0, 2);
point4 = Point.ByCoordinates(4, 0, 5);
point5 = Point.ByCoordinates(1, 0, 7);
point6 = Point.ByCoordinates(2, 0, 10);
# ----------------------------------------
list_create = List.Create(item0=code_block.point1, item1=code_block.point2, item2=code_block.point3, item3=code_block.point4, item4=code_block.point5, item5=code_block.point6)
code_block_2 = CodeBlock { 3; }
boolean = BoolSelector(false)
byControlPoints = NurbsCurve.ByControlPoints(points=list_create, degree=code_block_2, closeCurve=boolean)
code_block_3 = CodeBlock { 360; }
code_block_4 = CodeBlock { 6; }
boolean_2 = BoolSelector(true)
boolean_3 = BoolSelector(true)
byRevolve = TSpline.TSplineSurface.ByRevolve(profile=byControlPoints, sweepAngle=code_block_3, radialSpans=code_block_4, axialSpans=code_block_4, uniform=boolean_2, inSmoothMode=boolean_3)
directory_path = Directory("C:\TSplines")
string = StringInput("\ExportTSS.tss")
code_block_5 = CodeBlock(directory=directory_path, filename=string) { directory+filename; }
exportToTSS = TSpline.TSplineSurface.ExportToTSS(tSplineSurfaces=byRevolve, filePath=code_block_5)
watch = Watch(exportToTSS)
