# Dynamo graph Autodesk.DesignScript.Geometry.TSpline.TSplineSurface.FlipNormals.dyn (Dynamo 2.19.3.6543)

code_block = CodeBlock { 10; 5; }
boolean = BoolSelector(true)
byCylinderRadiusHeight = TSpline.TSplineSurface.ByCylinderRadiusHeight(radius=code_block.out0, height=code_block.out0, inSmoothMode=boolean)

# group: Visualize normals
regularFaces = TSpline.TSplineTopology.RegularFaces(tSplineTopology=byCylinderRadiusHeight)
UVNFrame = TSpline.TSplineFace.UVNFrame(tSplineFace=regularFaces)
position = TSpline.TSplineUVNFrame.Position(tSplineUVNFrame=UVNFrame)
normal = TSpline.TSplineUVNFrame.Normal(tSplineUVNFrame=UVNFrame)
code_block_2 = CodeBlock { 2; }
byStartPointDirectionLength = Line.ByStartPointDirectionLength(startPoint=position, direction=normal, length=code_block_2)

code_block_3 = CodeBlock { 25; }
translate = Geometry.Translate(geometry=byCylinderRadiusHeight, xTranslation=code_block_3)
flipNormals = TSpline.TSplineSurface.FlipNormals(tSplineSurface=translate)

# group: Visualize normals
regularFaces_2 = TSpline.TSplineTopology.RegularFaces(tSplineTopology=flipNormals)
UVNFrame_2 = TSpline.TSplineFace.UVNFrame(tSplineFace=regularFaces_2)
position_2 = TSpline.TSplineUVNFrame.Position(tSplineUVNFrame=UVNFrame_2)
normal_2 = TSpline.TSplineUVNFrame.Normal(tSplineUVNFrame=UVNFrame_2)
code_block_4 = CodeBlock { 2; }
byStartPointDirectionLength_2 = Line.ByStartPointDirectionLength(startPoint=position_2, direction=normal_2, length=code_block_4)
