# Dynamo graph Autodesk.DesignScript.Geometry.TSpline.TSplineSurface.Interpolate.dyn (Dynamo 2.19.3.6543)

code_block = CodeBlock { 4; 6; 2; }
code_block_2 = CodeBlock { 2; }
boolean = BoolSelector(true)
byBoxLengths = TSpline.TSplineSurface.ByBoxLengths(width=code_block.out0, length=code_block.out1, height=code_block.out2, xSpans=code_block_2, ySpans=code_block_2, zSpans=code_block_2, inSmoothMode=boolean)
boolean_2 = BoolSelector(false)
interpolate = TSpline.TSplineSurface.Interpolate(tSplineSurface=byBoxLengths, reverse=boolean_2)
code_block_3 = CodeBlock { 5; }
translate = Geometry.Translate(geometry=interpolate, xTranslation=code_block_3)
