# Dynamo graph Autodesk.DesignScript.Geometry.TSpline.TSplineSurface.IsWaterTight.dyn (Dynamo 2.19.3.6543)

code_block = CodeBlock { 5; }
boolean = BoolSelector(true)
bySphereCenterPointRadius = TSpline.TSplineSurface.BySphereCenterPointRadius(radius=code_block, inSmoothMode=boolean)
isClosed = TSpline.TSplineSurface.IsClosed(tSplineSurface=bySphereCenterPointRadius)
watch = Watch(isClosed)
isWaterTight = TSpline.TSplineSurface.IsWaterTight(tSplineSurface=bySphereCenterPointRadius)
watch_2 = Watch(isWaterTight)
