# Dynamo graph Autodesk.DesignScript.Geometry.TSpline.TSplineSurface.MakeUniform.dyn (Dynamo 2.19.3.6543)

# group: NURBS surface
byCoordinates = Point.ByCoordinates()
integer_slider = IntegerSlider(6, range=4..15 step 1)
code_block = CodeBlock(n=integer_slider) { n; }
code_block_2 = CodeBlock(n=code_block) { 0..n-1; }
translate = Geometry.Translate(geometry=byCoordinates, xTranslation=code_block_2, yTranslation=code_block_2, lacing=CrossProduct)
code_block_3 = CodeBlock(n=code_block) { n*n; }
randomList = Math.RandomList(amount=code_block_3)
chop = List.Chop(list=randomList, lengths=code_block)
integer_slider_2 = IntegerSlider(3, range=2..15 step 1)
integer_slider_3 = IntegerSlider(4, range=4..15 step 1)
remapRange = Math.RemapRange(numbers=chop, newMin=integer_slider_2, newMax=integer_slider_3)
translate_2 = Geometry.Translate(geometry=translate, zTranslation=remapRange, lacing=Shortest)
byPoints = NurbsSurface.ByPoints(points=translate_2)

boolean = BoolSelector(true)
byNurbsSurfaceCurvature = TSpline.TSplineSurface.ByNurbsSurfaceCurvature(nurbsSurface=byPoints, inSmoothMode=boolean)
code_block_4 = CodeBlock { 6; }
translate_3 = Geometry.Translate(geometry=byNurbsSurfaceCurvature, yTranslation=code_block_4)
makeUniform = TSpline.TSplineSurface.MakeUniform(tSplineSurface=translate_3)
