# Dynamo graph Autodesk.DesignScript.Geometry.TSpline.TSplineSurface.MergeEdges.dyn (Dynamo 2.19.3.6543)

code_block = CodeBlock()
# ---------- code_block.designscript (7 lines) ----------
point1 = Point.ByCoordinates(-5, 0, 0);
point2 = Point.ByCoordinates(-3, 5, 0);
point3 = Point.ByCoordinates(0, 8, 0);
point4 = Point.ByCoordinates(3, 5, 0);
point5 = Point.ByCoordinates(5, 0, 0);
t1 = List.Join([point1, point2, point3, point4, point5]);
nurbsCurve1 = NurbsCurve.ByPoints(t1);
# ----------------------------------------
code_block_2 = CodeBlock { 6; 4; 7; }
boolean = BoolSelector(true)
byExtrude = TSpline.TSplineSurface.ByExtrude(curve=code_block.nurbsCurve1, frontDistance=code_block_2.out0, frontSpans=code_block_2.out1, profileSpans=code_block_2.out2, inSmoothMode=boolean)
code_block_3 = CodeBlock { [63,65,67]; }
edgeByIndex = TSpline.TSplineTopology.EdgeByIndex(tSplineTopology=byExtrude, index=code_block_3)
code_block_4 = CodeBlock { [54,57,59]; }
edgeByIndex_2 = TSpline.TSplineTopology.EdgeByIndex(tSplineTopology=byExtrude, index=code_block_4)
boolean_2 = BoolSelector(false)
mergeEdges = TSpline.TSplineSurface.MergeEdges(tSplineSurface=byExtrude, firstGroup=edgeByIndex, secondGroup=edgeByIndex_2, insertCreases=boolean_2)
code_block_5 = CodeBlock { -12; }
translate = Geometry.Translate(geometry=mergeEdges, xTranslation=code_block_5)
