# Dynamo graph Autodesk.DesignScript.Geometry.TSpline.TSplineSurface.PullVertices.dyn (Dynamo 2.19.3.6543)

code_block = CodeBlock { 20; }
byCoordinates = Point.ByCoordinates(x=code_block, y=code_block)
code_block_2 = CodeBlock { 8; }
boolean = BoolSelector(true)
byPlaneOriginNormal = TSpline.TSplineSurface.ByPlaneOriginNormal(maxCorner=byCoordinates, xSpans=code_block_2, ySpans=code_block_2, inSmoothMode=boolean)
innerVertices = TSpline.TSplineTopology.InnerVertices(tSplineTopology=byPlaneOriginNormal)
code_block_3 = CodeBlock { 7; 10; }
byCoordinates_2 = Point.ByCoordinates(x=code_block_3.out0, y=code_block_3.out0, z=code_block_3.out1)
code_block_4 = CodeBlock { 7; }
byCenterPointRadius = Sphere.ByCenterPointRadius(centerPoint=byCoordinates_2, radius=code_block_4)
boolean_2 = BoolSelector(false)
pullVertices = TSpline.TSplineSurface.PullVertices(tSplineSurface=byPlaneOriginNormal, vertices=innerVertices, geometries=byCenterPointRadius, surfacePoints=boolean_2)
code_block_5 = CodeBlock { color1 = Color.ByARGB(80, 50, 100, 255); }
byGeometryColor = Modifiers.GeometryColor.ByGeometryColor(geometry=byCenterPointRadius, color=code_block_5)
