# Dynamo graph Autodesk.DesignScript.Geometry.TSpline.TSplineSurface.Reflections.dyn (Dynamo 2.19.3.6543)

code_block = CodeBlock { point1 = Point.ByCoordinates(10, 0, 0); 4; 0; 120; vector1 = Vector.ByCoordinates(0, 1, 0); }
byCenterPointRadiusAngle = Arc.ByCenterPointRadiusAngle(center=code_block.point1, radius=code_block.out1, startAngle=code_block.out2, endAngle=code_block.out3, normal=code_block.vector1)
code_block_2 = CodeBlock { 10; }
code_block_3 = CodeBlock { 0; 45; }
byCenterPointRadiusAngle_2 = Arc.ByCenterPointRadiusAngle(radius=code_block_2, startAngle=code_block_3.out0, endAngle=code_block_3.out1)
boolean = BoolSelector(false)
code_block_4 = CodeBlock { 3; 3; }
boolean_2 = BoolSelector(true)
bySweep = TSpline.TSplineSurface.BySweep(profile=byCenterPointRadiusAngle, path=byCenterPointRadiusAngle_2, parallel=boolean, pathSpans=code_block_4.out0, profileSpans=code_block_4.out1, inSmoothMode=boolean_2)

# group: Radial Reflection
# AROUND VECTOR 0,0,1
byRadial = TSpline.TSplineReflection.ByRadial()

# group: Axial Reflection
# AROUND XY PLANE
byOriginNormal = Plane.ByOriginNormal()
byAxial = TSpline.TSplineReflection.ByAxial(plane=byOriginNormal)

join = List.Join(list0=byRadial, list1=byAxial)
boolean_3 = BoolSelector(true)
addReflections = TSpline.TSplineSurface.AddReflections(tSplineSurface=bySweep, reflections=join, weldSymmetricPortions=boolean_3)
removeReflections = TSpline.TSplineSurface.RemoveReflections(tSplineSurface=addReflections)
reflections = TSpline.TSplineSurface.Reflections(tSplineSurface=removeReflections)
reflections_2 = TSpline.TSplineSurface.Reflections(tSplineSurface=addReflections)
watch = Watch(reflections_2)
