# Dynamo graph Autodesk.DesignScript.Geometry.TSpline.TSplineSurface.SlideEdges.dyn (Dynamo 2.19.3.6543)

code_block = CodeBlock { 20; 10; 20; }
code_block_2 = CodeBlock { 3; 5; }
boolean = BoolSelector(true)
byBoxLengths = TSpline.TSplineSurface.ByBoxLengths(width=code_block.out0, length=code_block.out1, height=code_block.out2, xSpans=code_block_2.out0, zSpans=code_block_2.out1, inSmoothMode=boolean)
integer_slider = IntegerSlider(52, range=0..100 step 1)
edgeByIndex = TSpline.TSplineTopology.EdgeByIndex(tSplineTopology=byBoxLengths, index=integer_slider)
UVNFrame = TSpline.TSplineEdge.UVNFrame(tSplineEdge=edgeByIndex)
position = TSpline.TSplineUVNFrame.Position(tSplineUVNFrame=UVNFrame)
number_slider = DoubleSlider(0.7, range=0..2 step 0.1)
code_block_3 = CodeBlock { 0.5; }
slideEdges = TSpline.TSplineSurface.SlideEdges(tSplineSurface=byBoxLengths, edges=edgeByIndex, amount=number_slider, roundness=code_block_3)
code_block_4 = CodeBlock { 25; }
translate = Geometry.Translate(geometry=slideEdges, xTranslation=code_block_4)
