# Dynamo graph Autodesk.DesignScript.Geometry.TSpline.TSplineSurface.Standardize.dyn (Dynamo 2.13.1.3887)

code_block = CodeBlock { 3; }
boolean = BoolSelector(true)
byBoxLengths = TSpline.TSplineSurface.ByBoxLengths(xSpans=code_block, ySpans=code_block, zSpans=code_block, inSmoothMode=boolean)
code_block_2 = CodeBlock { 5; }
faceByIndex = TSpline.TSplineTopology.FaceByIndex(tSplineTopology=byBoxLengths, index=code_block_2)
boolean_2 = BoolSelector(false)
subdivideFaces = TSpline.TSplineSurface.SubdivideFaces(tSplineSurface=byBoxLengths, faces=faceByIndex, exact=boolean_2)
isStandard = TSpline.TSplineSurface.IsStandard(tSplineSurface=subdivideFaces)
watch = Watch(isStandard)
code_block_3 = CodeBlock { 2; }
translate = Geometry.Translate(geometry=subdivideFaces, xTranslation=code_block_3)
standardize = TSpline.TSplineSurface.Standardize(tSplineSurface=translate)
isStandard_2 = TSpline.TSplineSurface.IsStandard(tSplineSurface=standardize)
watch_2 = Watch(isStandard_2)
UVNFrame = TSpline.TSplineFace.UVNFrame(tSplineFace=faceByIndex)
position = TSpline.TSplineUVNFrame.Position(tSplineUVNFrame=UVNFrame)
