# Dynamo graph Autodesk.DesignScript.Geometry.TSpline.TSplineSurface.ToMesh.dyn (Dynamo 2.19.3.6543)

code_block = CodeBlock { 35; 50; }
byCoordinates = Point.ByCoordinates(x=code_block.out0, y=code_block.out0, z=code_block.out1)
code_block_2 = CodeBlock { 3; }
boolean = BoolSelector(true)
byBoxCorners = TSpline.TSplineSurface.ByBoxCorners(highPoint=byCoordinates, xSpans=code_block_2, ySpans=code_block_2, zSpans=code_block_2, inSmoothMode=boolean)
number_slider = DoubleSlider(1, range=0..100 step 1)
code_block_3 = CodeBlock { 0.01; }
toMesh = TSpline.TSplineSurface.ToMesh(tSplineSurface=byBoxCorners, minSegments=number_slider, tolerance=code_block_3)
vertexPositions = Mesh.VertexPositions(mesh=toMesh)
