# Dynamo graph Autodesk.DesignScript.Geometry.TSpline.TSplineSurface.UnweldEdges.dyn (Dynamo 2.19.3.6543)

byOriginVectors = Ellipse.ByOriginVectors()
code_block = CodeBlock { point1 = Point.ByCoordinates(0, 0, 0); point2 = Point.ByCoordinates(0, 0, 4); point3 = Point.ByCoordinates(6, 0, 6); }
list_create = List.Create(item0=code_block.point1, item1=code_block.point2, item2=code_block.point3)
byPoints = NurbsCurve.ByPoints(points=list_create)
boolean = BoolSelector(false)
code_block_2 = CodeBlock { 6; 8; }
boolean_2 = BoolSelector(true)
boolean_3 = BoolSelector(true)
boolean_4 = BoolSelector(true)
bySweep = TSpline.TSplineSurface.BySweep(profile=byOriginVectors, path=byPoints, parallel=boolean, pathSpans=code_block_2.out0, profileSpans=code_block_2.out1, pathUniform=boolean_2, profileUniform=boolean_3, inSmoothMode=boolean_4)
verticesCount = TSpline.TSplineTopology.VerticesCount(tSplineTopology=bySweep)
decomposedEdges = TSpline.TSplineTopology.DecomposedEdges(tSplineTopology=bySweep)
code_block_3 = CodeBlock { 6; }
takeItems = List.TakeItems(list=decomposedEdges.inner, amount=code_block_3)
unweldEdges = TSpline.TSplineSurface.UnweldEdges(tSplineSurface=bySweep, edges=takeItems)
verticesCount_2 = TSpline.TSplineTopology.VerticesCount(tSplineTopology=unweldEdges)
code_block_4 = CodeBlock { [0,1,2]; }
vertexByIndex = TSpline.TSplineTopology.VertexByIndex(tSplineTopology=unweldEdges, index=code_block_4)
code_block_5 = CodeBlock { 3; }
byCoordinates = Vector.ByCoordinates(y=code_block_5)
moveVertices = TSpline.TSplineSurface.MoveVertices(tSplineSurface=unweldEdges, vertices=vertexByIndex, vector=byCoordinates)
