# Dynamo graph Autodesk.DesignScript.Geometry.TSpline.TSplineTopology.BorderFaces.dyn (Dynamo 2.13.1.3887)

code_block = CodeBlock { 0; }
byCoordinates = Point.ByCoordinates(x=code_block, y=code_block, z=code_block)
code_block_2 = CodeBlock { 6; }
byCoordinates_2 = Point.ByCoordinates(z=code_block_2)
code_block_3 = CodeBlock { 3; 9; }
boolean = BoolSelector(true)
byCylinderPointsRadius = TSpline.TSplineSurface.ByCylinderPointsRadius(startPoint=byCoordinates, endPoint=byCoordinates_2, radius=code_block_3.out0, radiusSpans=code_block_3.out1, heightSpans=code_block_3.out1, inSmoothMode=boolean)
code_block_4 = CodeBlock { 2; }
thicken = TSpline.TSplineSurface.Thicken(tSplineSurface=byCylinderPointsRadius, distance=code_block_4)
XAxis = Vector.XAxis()
code_block_5 = CodeBlock { 12; }
translate = Geometry.Translate(geometry=thicken, direction=XAxis, distance=code_block_5)
borderFaces = TSpline.TSplineTopology.BorderFaces(tSplineTopology=byCylinderPointsRadius)
watch = Watch(borderFaces)
borderFaces_2 = TSpline.TSplineTopology.BorderFaces(tSplineTopology=thicken)
watch_2 = Watch(borderFaces_2)
