# Dynamo graph Autodesk.DesignScript.Geometry.TSpline.TSplineTopology.FaceByIndex.dyn (Dynamo 2.19.3.6543)

code_block = CodeBlock { 4; }
byCoordinates = Point.ByCoordinates(x=code_block, y=code_block, z=code_block)
code_block_2 = CodeBlock { 8; }
code_block_3 = CodeBlock { 4; }
boolean = BoolSelector(true)
byBoxLengths = TSpline.TSplineSurface.ByBoxLengths(origin=byCoordinates, width=code_block_2, length=code_block_2, height=code_block_2, xSpans=code_block_3, ySpans=code_block_3, zSpans=code_block_3, inSmoothMode=boolean)
integer_slider = IntegerSlider(45, range=0..97 step 1)
faceByIndex = TSpline.TSplineTopology.FaceByIndex(tSplineTopology=byBoxLengths, index=integer_slider)
code_block_4 = CodeBlock { -1; }
byCoordinates_2 = Vector.ByCoordinates(y=code_block_4)
code_block_5 = CodeBlock { 1; }
extrudeFaces = TSpline.TSplineSurface.ExtrudeFaces(tSplineSurface=byBoxLengths, faces=faceByIndex, direction=byCoordinates_2, spans=code_block_5)
