# Dynamo graph Autodesk.DesignScript.Geometry.TSpline.TSplineUVNFrame.Normal.dyn (Dynamo 3.0.0.5795)

code_block = CodeBlock { 70; 20; 15; }
byCoordinates = Point.ByCoordinates(x=code_block.out0, y=code_block.out1, z=code_block.out2)
code_block_2 = CodeBlock { 5; 5; 3; }
boolean = BoolSelector(true)
byBoxCorners = TSpline.TSplineSurface.ByBoxCorners(highPoint=byCoordinates, xSpans=code_block_2.out0, ySpans=code_block_2.out1, zSpans=code_block_2.out2, inSmoothMode=boolean)
innerVertices = TSpline.TSplineTopology.InnerVertices(tSplineTopology=byBoxCorners)
UVNFrame = TSpline.TSplineVertex.UVNFrame(tSplineVertex=innerVertices)
position = TSpline.TSplineUVNFrame.Position(tSplineUVNFrame=UVNFrame)
normal = TSpline.TSplineUVNFrame.Normal(tSplineUVNFrame=UVNFrame)
code_block_3 = CodeBlock { 5; }
byStartPointDirectionLength = Line.ByStartPointDirectionLength(startPoint=position, direction=normal, length=code_block_3)
