# Dynamo graph Autodesk.DesignScript.Geometry.TSpline.TSplineVertex.Info.dyn (Dynamo 3.0.0.5795)

code_block = CodeBlock { 70; 20; 15; }
byCoordinates = Point.ByCoordinates(x=code_block.out0, y=code_block.out1, z=code_block.out2)
code_block_2 = CodeBlock { 5; 5; 3; }
boolean = BoolSelector(true)
byBoxCorners = TSpline.TSplineSurface.ByBoxCorners(highPoint=byCoordinates, xSpans=code_block_2.out0, ySpans=code_block_2.out1, zSpans=code_block_2.out2, inSmoothMode=boolean)
number_slider = DoubleSlider(1, range=0..100 step 0.1)
vertexByIndex = TSpline.TSplineTopology.VertexByIndex(tSplineTopology=byBoxCorners, index=number_slider)
info = TSpline.TSplineVertex.Info(tSplineVertex=vertexByIndex)
watch = Watch(info.uvnFrame)
watch_2 = Watch(info.index)
watch_3 = Watch(info.isStarPoint)
watch_4 = Watch(info.isManifold)
watch_5 = Watch(info.valence)
watch_6 = Watch(info.functionalValence)
watch_7 = Watch(info.isTPoint)
UVNFrame = TSpline.TSplineVertex.UVNFrame()  # unwired: tSplineVertex
