# Dynamo graph Autodesk.DesignScript.Geometry.TSpline.TSplineVertex.IsManifold.dyn (Dynamo 2.19.3.6543)

# group: Pt1
code_block = CodeBlock { 40; }
byCoordinates = Point.ByCoordinates(y=code_block)

# group: Pt2
code_block_2 = CodeBlock { 20; }
byCoordinates_2 = Point.ByCoordinates(x=code_block_2, y=code_block_2)

byStartPointEndPoint = Line.ByStartPointEndPoint(startPoint=byCoordinates, endPoint=byCoordinates_2)

# group: Pt3
code_block_3 = CodeBlock { 40; 15; }
byCoordinates_3 = Point.ByCoordinates(x=code_block_3.out0, y=code_block_3.out1)

byStartPointEndPoint_2 = Line.ByStartPointEndPoint(startPoint=byCoordinates_2, endPoint=byCoordinates_3)
join = Curve.Join(curve=byStartPointEndPoint, curves=byStartPointEndPoint_2)
code_block_4 = CodeBlock { 15; }
byExtrude = TSpline.TSplineSurface.ByExtrude(curve=join, frontDistance=code_block_4)
code_block_5 = CodeBlock { 5; }
edgeByIndex = TSpline.TSplineTopology.EdgeByIndex(tSplineTopology=byExtrude, index=code_block_5)

# group: Pt4
code_block_6 = CodeBlock { 8; }
byCoordinates_4 = Point.ByCoordinates(y=code_block_6)

byStartPointEndPoint_3 = Line.ByStartPointEndPoint(startPoint=byCoordinates_2, endPoint=byCoordinates_4)
byExtrude_2 = TSpline.TSplineSurface.ByExtrude(curve=byStartPointEndPoint_3, frontDistance=code_block_4)
code_block_7 = CodeBlock { 2; }
edgeByIndex_2 = TSpline.TSplineTopology.EdgeByIndex(tSplineTopology=byExtrude_2, index=code_block_7)
bridgeEdgesToEdges = TSpline.TSplineSurface.BridgeEdgesToEdges(tSplineSurface=byExtrude, firstGroup=edgeByIndex, secondGroup=edgeByIndex_2)
decomposedVertices = TSpline.TSplineTopology.DecomposedVertices(tSplineTopology=bridgeEdgesToEdges)
isManifold = TSpline.TSplineVertex.IsManifold(tSplineVertex=decomposedVertices.all)
watch = Watch(isManifold)
UVNFrame = TSpline.TSplineVertex.UVNFrame(tSplineVertex=decomposedVertices.nonManifold)
position = TSpline.TSplineUVNFrame.Position(tSplineUVNFrame=UVNFrame)
