# Dynamo graph Autodesk.DesignScript.Geometry.TSpline.TSplineVertex.UVNFrame.dyn (Dynamo 3.0.0.5795)

code_block = CodeBlock { 5; 20; }
code_block_2 = CodeBlock { 5; 8; }
boolean = BoolSelector(true)
byTorusCenterRadii = TSpline.TSplineSurface.ByTorusCenterRadii(innerRadius=code_block.out0, outerRadius=code_block.out1, innerRadiusSpans=code_block_2.out0, outerRadiusSpans=code_block_2.out1, inSmoothMode=boolean)
number_slider = DoubleSlider(3, range=0..50 step 1)
vertexByIndex = TSpline.TSplineTopology.VertexByIndex(tSplineTopology=byTorusCenterRadii, index=number_slider)
UVNFrame = TSpline.TSplineVertex.UVNFrame(tSplineVertex=vertexByIndex)
normal = TSpline.TSplineUVNFrame.Normal(tSplineUVNFrame=UVNFrame)
code_block_3 = CodeBlock { 35; }
scale = Vector.Scale(vector=normal, scale_factor=code_block_3)
moveVertices = TSpline.TSplineSurface.MoveVertices(tSplineSurface=byTorusCenterRadii, vertices=vertexByIndex, vector=scale)
watch = Watch(UVNFrame)
