# Dynamo graph Autodesk.DesignScript.Geometry.TSpline.TSplineVertex.Valence.dyn (Dynamo 3.0.0.5795)

code_block = CodeBlock { 20; 3; }
boolean = BoolSelector(true)
byQuadballCenterRadius = TSpline.TSplineSurface.ByQuadballCenterRadius(radius=code_block.out0, spans=code_block.out1, inSmoothMode=boolean)
number_slider = DoubleSlider(24, range=0..58 step 1)
vertexByIndex = TSpline.TSplineTopology.VertexByIndex(tSplineTopology=byQuadballCenterRadius, index=number_slider)
valence = TSpline.TSplineVertex.Valence(tSplineVertex=vertexByIndex)
watch = Watch(valence)
UVNFrame = TSpline.TSplineVertex.UVNFrame(tSplineVertex=vertexByIndex)
position = TSpline.TSplineUVNFrame.Position(tSplineUVNFrame=UVNFrame)
