# Dynamo graph Autodesk.DesignScript.Geometry.Topology.Edges.dyn "Edges" (Dynamo 2.0.1.5055)

byCorners = Cuboid.ByCorners()
edges = Topology.Edges(topology=byCorners)
watch = Watch(edges)
curveGeometry = Edge.CurveGeometry(edge=watch)
code_block = CodeBlock(geometry=byCorners) { color = Color.ByARGB(100,141,198,217); GeometryColor.ByGeometryColor(geometry, color); }
