# Dynamo graph Autodesk.DesignScript.Geometry.Topology.Faces.dyn "Faces" (Dynamo 2.0.1.5055)

code_block = CodeBlock { cube = Cuboid.ByLengths(4,4,4); PolySurface.BySolid(cube); }
edges = Topology.Edges(topology=code_block.out1)
code_block_2 = CodeBlock { 1.2; }
chamfer = PolySurface.Chamfer(polySurface=code_block.out1, edges=edges, offset=code_block_2)
faces = Topology.Faces(topology=chamfer)
watch = Watch(faces)
edges_2 = Topology.Edges(topology=chamfer)
code_block_3 = CodeBlock { 0.3; }
chamfer_2 = PolySurface.Chamfer(polySurface=chamfer, edges=edges_2, offset=code_block_3)
faces_2 = Topology.Faces(topology=chamfer_2)
watch_2 = Watch(faces_2)
code_block_4 = CodeBlock(geo=chamfer_2) { vect = Vector.XAxis(); dist = 5; Geometry.Translate(geo, vect, dist); }
