# Dynamo graph Autodesk.DesignScript.Geometry.UV.V.dyn "V" (Dynamo 2.0.1.5055)

code_block = CodeBlock()
# ---------- code_block.designscript (5 lines) ----------
x = Math.RandomList(4);
y = Math.RandomList(4);
z = Math.RandomList(4);
pts = Point.ByCoordinates(x*10,y*10,z*10);
NurbsCurve.ByPoints(pts, true);
# ----------------------------------------
byPatch = Surface.ByPatch(closedCurve=code_block.out4)
approximateWithTolerance = Surface.ApproximateWithTolerance(surface=byPatch)
integer_slider = IntegerSlider(468, range=0..500 step 1)  # graph input
code_block_2 = CodeBlock(nSurface=approximateWithTolerance, uv_Index=integer_slider)
# ---------- code_block_2.designscript (3 lines) ----------
controlPts = NurbsSurface.ControlPoints(nSurface);
controlPts2 = List.Flatten(controlPts, -1);
controlPt = List.GetItemAtIndex(controlPts2, uv_Index);
# ----------------------------------------
UVParameterAtPoint = Surface.UVParameterAtPoint(surface=approximateWithTolerance, point=code_block_2.controlPt)
V = UV.V(uV=UVParameterAtPoint)
watch = Watch(V)
watch_2 = Watch(UVParameterAtPoint)
