# Dynamo graph Autodesk.DesignScript.Geometry.Vector.Add.dyn "Add" (Dynamo 2.0.1.5055)

origin = Point.Origin()
ZAxis = Vector.ZAxis()
XAxis = Vector.XAxis()
add = Vector.Add(vector=ZAxis, vectorToAdd=XAxis)
code_block = CodeBlock { 5; }
byStartPointDirectionLength = Line.ByStartPointDirectionLength(startPoint=origin, direction=add, length=code_block)
