# Dynamo graph Autodesk.DesignScript.Geometry.Vector.AsPoint.dyn "AsPoint" (Dynamo 2.0.1.5055)

code_block = CodeBlock { 10; 5; 6; }
byCoordinates = Vector.ByCoordinates(x=code_block.out0, y=code_block.out1, z=code_block.out2)
asPoint = Vector.AsPoint(vector=byCoordinates)
watch = Watch(asPoint)
