# Dynamo graph Autodesk.DesignScript.Geometry.Vector.ByCoordinates(x, y, z).dyn "ByCoordinates" (Dynamo 2.0.1.5055)

origin = Point.Origin()
code_block = CodeBlock { 1; }
byCoordinates = Vector.ByCoordinates(x=code_block, z=code_block)
code_block_2 = CodeBlock { 10; }
byStartPointDirectionLength = Line.ByStartPointDirectionLength(startPoint=origin, direction=byCoordinates, length=code_block_2)
