# Dynamo graph Autodesk.DesignScript.Geometry.Vector.Cross.dyn "Cross" (Dynamo 2.0.1.5055)

origin = Point.Origin()
code_block = CodeBlock { Vector.ByCoordinates(10,5,6); Vector.ByCoordinates(1,10,1); 5; }
byStartPointDirectionLength = Line.ByStartPointDirectionLength(startPoint=origin, direction=code_block.out0, length=code_block.out2)
byStartPointDirectionLength_2 = Line.ByStartPointDirectionLength(startPoint=origin, direction=code_block.out1, length=code_block.out2)
cross = Vector.Cross(vector=code_block.out0, cross=code_block.out1)
byStartPointDirectionLength_3 = Line.ByStartPointDirectionLength(startPoint=origin, direction=cross, length=code_block.out2)
