# Dynamo graph Autodesk.DesignScript.Geometry.Vector.Rotate(vector, axis, degrees).dyn "Autodesk.DesignScript.Geometry.Vector.Rotate" (Dynamo 2.19.0.5742)

origin = Point.Origin()
code_block = CodeBlock { 1; }
byCoordinates = Vector.ByCoordinates(x=code_block, y=code_block, z=code_block)
ZAxis = Vector.ZAxis()
number_slider = DoubleSlider(30.7, range=0..100 step 0.1)  # graph input
rotate = Vector.Rotate(vector=byCoordinates, axis=ZAxis, degrees=number_slider)
code_block_2 = CodeBlock { 4; }
byStartPointDirectionLength = Line.ByStartPointDirectionLength(startPoint=origin, direction=rotate, length=code_block_2)
XAxis = Vector.XAxis()
YAxis = Vector.YAxis()
