# Dynamo graph Autodesk.DesignScript.Geometry.Vector.Scale(scale_factor).dyn "Scale" (Dynamo 2.0.1.5055)

code_block = CodeBlock { 1; }
byCoordinates = Vector.ByCoordinates(x=code_block, y=code_block, z=code_block)
number_slider = DoubleSlider(7.2, range=0..10 step 0.1)  # graph input
scale = Vector.Scale(vector=byCoordinates, scale_factor=number_slider)
length = Vector.Length(vector=scale)
watch = Watch(length)
length_2 = Vector.Length(vector=byCoordinates)
watch_2 = Watch(length_2)
