# Dynamo graph Autodesk.DesignScript.Geometry.Vector.Subtract.dyn "Subtract" (Dynamo 2.0.1.5055)

code_block = CodeBlock { 1; }
number_slider = DoubleSlider(1.42, range=0..5 step 0.01)  # graph input
byCoordinates = Vector.ByCoordinates(x=code_block, z=number_slider)
ZAxis = Vector.ZAxis()
ZAxis_2 = Vector.ZAxis()
subtract = Vector.Subtract(vector=byCoordinates, vectorToSubtract=ZAxis_2)
code_block_2 = CodeBlock(v1=byCoordinates, v2=ZAxis, v3=subtract)
# ---------- code_block_2.designscript (5 lines) ----------
pt = Point.ByCoordinates(0,0,0);

Line.ByStartPointDirectionLength(pt, v1, 5);
Line.ByStartPointDirectionLength(pt, v2, 5);
Line.ByStartPointDirectionLength(pt, v3, 5);
# ----------------------------------------
subtracted_vector = Object.Identity(obj=code_block_2.out3)
