# Dynamo graph Autodesk.DesignScript.Geometry.Vector.Transform.dyn "Transform" (Dynamo 2.0.1.5055)

number_slider = DoubleSlider(2.7, range=0.1..5 step 0.1)  # graph input
number_slider_2 = DoubleSlider(65.7, range=-100..100 step 0.1)  # graph input
number_slider_3 = DoubleSlider(13.1, range=0..100 step 0.1)  # graph input
bySphericalCoordinates = CoordinateSystem.BySphericalCoordinates(radius=number_slider, theta=number_slider_2, phi=number_slider_3)
origin = CoordinateSystem.Origin(coordinateSystem=bySphericalCoordinates)
code_block = CodeBlock { 2; }
byCoordinates = Vector.ByCoordinates(x=code_block, y=code_block, z=code_block)
transform = Vector.Transform(vector=byCoordinates, cs=bySphericalCoordinates)
code_block_2 = CodeBlock { 5; }
byStartPointDirectionLength = Line.ByStartPointDirectionLength(startPoint=origin, direction=transform, length=code_block_2)
origin_2 = Point.Origin()
byStartPointDirectionLength_2 = Line.ByStartPointDirectionLength(startPoint=origin_2, direction=byCoordinates, length=code_block_2)
