# Dynamo graph Autodesk.DesignScript.Geometry.Vector.XAxis.dyn "XAxis" (Dynamo 2.0.1.5055)

origin = Point.Origin()
XAxis = Vector.XAxis()
code_block = CodeBlock { 10; }
byStartPointDirectionLength = Line.ByStartPointDirectionLength(startPoint=origin, direction=XAxis, length=code_block)
