# Dynamo graph Autodesk.DesignScript.Geometry.Vector.ZAxis.dyn "ZAxis" (Dynamo 2.0.1.5055)

origin = Point.Origin()
ZAxis = Vector.ZAxis()
code_block = CodeBlock { 10; }
byStartPointDirectionLength = Line.ByStartPointDirectionLength(startPoint=origin, direction=ZAxis, length=code_block)
