# Dynamo graph Autodesk.DesignScript.Geometry.Vertex.AdjacentEdges.dyn "AdjacentEdges" (Dynamo 2.0.1.5055)

code_block = CodeBlock { 4; }
byCoordinates = Point.ByCoordinates(x=code_block, y=code_block, z=code_block)
byCorners = Cuboid.ByCorners(highPoint=byCoordinates)
edges = Topology.Edges(topology=byCorners)
startVertex = Edge.StartVertex(edge=edges)
edges_2 = DoubleSlider(8, range=0..11 step 1)  # graph input
getItemAtIndex = List.GetItemAtIndex(list=startVertex, index=edges_2)
adjacentEdges = Vertex.AdjacentEdges(vertex=getItemAtIndex)
watch = Watch(adjacentEdges)
curveGeometry = Edge.CurveGeometry(edge=adjacentEdges)
code_block_2 = CodeBlock(geometry=byCorners) { color = Color.ByARGB(100,141,198,217); GeometryColor.ByGeometryColor(geometry, color); }
