# Dynamo graph Autodesk.DesignScript.Geometry.Vertex.PointGeometry.dyn "PointGeometry" (Dynamo 2.0.1.5055)

code_block = CodeBlock { 4; }
byCoordinates = Point.ByCoordinates(x=code_block, y=code_block, z=code_block)
byCorners = Cuboid.ByCorners(highPoint=byCoordinates)
edges = Topology.Edges(topology=byCorners)
startVertex = Edge.StartVertex(edge=edges)
pointGeometry = Vertex.PointGeometry(vertex=startVertex)
code_block_2 = CodeBlock(geometry=byCorners) { color = Color.ByARGB(100,141,198,217); GeometryColor.ByGeometryColor(geometry, color); }
