# Dynamo graph BUMI5UR5LLKRXP5CUH46L62SN6YIVFGB6FU2PUTKTVDJMTXWXI5Q.dyn (Dynamo 2.19.3.6543)

# note: Curve

boolean = BoolSelector(false)
refinement = CodeBlock { 4; 0.01; }
boolean_2 = BoolSelector(true)
integer_slider = IntegerSlider(3, range=0..10 step 1)

# group: T-Spline Surface
code_block = CodeBlock { 10; 25; }
byCoordinates = Point.ByCoordinates(x=code_block.out0, y=code_block.out1)
code_block_2 = CodeBlock { 15; }
byCoordinates_2 = Point.ByCoordinates(y=code_block_2)
code_block_3 = CodeBlock { 3; }
boolean_3 = BoolSelector(true)
byPlaneOriginNormal = TSpline.TSplineSurface.ByPlaneOriginNormal(minCorner=byCoordinates, maxCorner=byCoordinates_2, xSpans=code_block_3, ySpans=code_block_3, inSmoothMode=boolean_3)
code_block_4 = CodeBlock { [0,3]; }
vertexByIndex = TSpline.TSplineTopology.VertexByIndex(tSplineTopology=byPlaneOriginNormal, index=code_block_4)
deleteVertices = TSpline.TSplineSurface.DeleteVertices(tSplineSurface=byPlaneOriginNormal, vertices=vertexByIndex)
code_block_5 = CodeBlock { [13,14,10,9]; }
vertexByIndex_2 = TSpline.TSplineTopology.VertexByIndex(tSplineTopology=deleteVertices, index=code_block_5)
code_block_6 = CodeBlock { 4; }
byCoordinates_3 = Vector.ByCoordinates(z=code_block_6)
moveVertices = TSpline.TSplineSurface.MoveVertices(tSplineSurface=deleteVertices, vertices=vertexByIndex_2, vector=byCoordinates_3)

code_block_7 = CodeBlock { [9,10,11]; }
edgeByIndex = TSpline.TSplineTopology.EdgeByIndex(tSplineTopology=moveVertices, index=code_block_7)

# group: Surface
byCoordinates_4 = Point.ByCoordinates()
integer_slider_2 = IntegerSlider(6, range=4..15 step 1)
code_block_8 = CodeBlock(n=integer_slider_2) { n; }
code_block_9 = CodeBlock(n=code_block_8) { 0..n-1; }
code_block_10 = CodeBlock { 2; }
code_block_11 = CodeBlock(x=code_block_9, scale=code_block_10) { x*scale; }
translate = Geometry.Translate(geometry=byCoordinates_4, xTranslation=code_block_11, yTranslation=code_block_11, lacing=CrossProduct)
code_block_12 = CodeBlock(n=code_block_8) { n*n; }
randomList = Math.RandomList(amount=code_block_12)
chop = List.Chop(list=randomList, lengths=code_block_8)
integer_slider_3 = IntegerSlider(0, range=0..15 step 1)
integer_slider_4 = IntegerSlider(3, range=2..15 step 1)
remapRange = Math.RemapRange(numbers=chop, newMin=integer_slider_3, newMax=integer_slider_4)
translate_2 = Geometry.Translate(geometry=translate, zTranslation=remapRange, lacing=Shortest)
byControlPoints = NurbsCurve.ByControlPoints(points=translate_2)
code_block_13 = CodeBlock(x=translate, n=code_block_8) { x[n-1][0]; x[0][0]; }
byStartPointEndPoint = Line.ByStartPointEndPoint(startPoint=code_block_13.out1, endPoint=code_block_13.out0)
byLoft = Surface.ByLoft(crossSections=byControlPoints, guideCurves=byStartPointEndPoint)

edges = Topology.Edges(topology=byLoft)
code_block_14 = CodeBlock { 1; }
getItemAtIndex = List.GetItemAtIndex(list=edges, index=code_block_14)
continuity = CodeBlock { 0; }
boolean_4 = BoolSelector(true)
boolean_5 = BoolSelector(true)
createMatch = TSpline.TSplineSurface.CreateMatch(tSplineSurface=moveVertices, tsEdges=edgeByIndex, brepEdges=getItemAtIndex, continuity=continuity, useArclength=boolean_4, useRefinement=boolean_5)
