# Dynamo graph C4KTVIQMR24V34QUQQ3FENYOOIOHKLUQ3SSJL3SVKQ2Z4QHWN4ZQ.dyn "Autodesk.DesignScript.Geometry.TSpline.TSplineSurface.ByNurbsSurfaceUniform" (Dynamo 2.19.3.6543)

code_block = CodeBlock { 10; }
byCoordinates = Point.ByCoordinates(z=code_block)
byOriginXAxisYAxis = Plane.ByOriginXAxisYAxis(origin=byCoordinates)
code_block_2 = CodeBlock { 30; }
byWidthLength = Rectangle.ByWidthLength(plane=byOriginXAxisYAxis, width=code_block_2, length=code_block_2)
byPatch = Surface.ByPatch(closedCurve=byWidthLength)
code_block_3 = CodeBlock { 0..1..#50; }
pointAtParameter = Surface.PointAtParameter(surface=byPatch, u=code_block_3, v=code_block_3, lacing=CrossProduct)
ZAxis = Vector.ZAxis()
integer_slider = IntegerSlider(2, range=1..5 step 1)  # graph input
integer_slider_2 = IntegerSlider(2, range=0..10 step 1)  # graph input
code_block_4 = CodeBlock(x=code_block_3, cycles=integer_slider, amp=integer_slider_2)
# ---------- code_block_4.designscript (3 lines) ----------
sineList=(0..Math.Sin(x*360*cycles)..#List.Count(x))*amp;
transposeList=List.Transpose(sineList);
eggShellList=sineList+transposeList;
# ----------------------------------------
translate = Geometry.Translate(geometry=pointAtParameter, direction=ZAxis, distance=code_block_4.eggShellList)
byPoints = NurbsSurface.ByPoints(points=translate)
code_block_5 = CodeBlock { 5; 15; }
boolean = BoolSelector(true)
boolean_2 = BoolSelector(true)
boolean_3 = BoolSelector(true)
byNurbsSurfaceUniform = TSpline.TSplineSurface.ByNurbsSurfaceUniform(nurbsSurface=byPoints, uSpans=code_block_5.out0, vSpans=code_block_5.out1, uUseArcLen=boolean, vUseArcLen=boolean_2, inSmoothMode=boolean_3)
