# Dynamo graph CMTCHCAMGXJZYOGATCJYXZM5UMWN5Y5GZ22WIK5267BVMYHEGSCQ.dyn "ByWidthLength" (Dynamo 2.0.1.5055)

number_slider = DoubleSlider(4.4, range=1..10 step 0.1)  # graph input
number_slider_2 = DoubleSlider(2.8, range=1..10 step 0.1)  # graph input
byWidthLength = Rectangle.ByWidthLength(width=number_slider, length=number_slider_2)
