# Dynamo graph CoreNodeModels.CreateList.dyn "CoreNodeModels.CreateList_img" (Dynamo 2.17.0.3255)

integer_slider = IntegerSlider(1, range=0..100 step 1)
integer_slider_2 = IntegerSlider(25, range=0..100 step 1)
integer_slider_3 = IntegerSlider(2, range=0..100 step 1)
list_create = List.Create(item0=integer_slider, item1=integer_slider_2, item2=integer_slider_3)
watch = Watch(list_create)
