# Dynamo graph CoreNodeModels.FormattedStringFromArray.dyn (Dynamo 3.5.0.6885)

number = DoubleInput(1000)
number_2 = DoubleInput(10000)
range = Range(start=number, end=number_2, step=number)
string = StringInput("N")
formatted_string_from_array = FormattedStringFromArray(object=range, formatSpecifier=string)
watch = Watch(formatted_string_from_array)
