# Dynamo graph CoreNodeModels.FormattedStringFromObject.dyn (Dynamo 3.5.0.6885)

number = DoubleInput(10000000)
string = StringInput("N")
formatted_string_from_object = FormattedStringFromObject(object=number, formatSpecifier=string)
