# Dynamo graph CoreNodeModels.HigherOrder.ApplyFunction.dyn (Dynamo 1.1.0.2093)

translate = Geometry.Translate()
code_block = CodeBlock { Point.ByCoordinates(0,0); }
XAxis = Vector.XAxis()
number_slider = DoubleSlider(1.5, range=0..3 step 0.1)
scale = Vector.Scale(vector=XAxis, scale_factor=number_slider)
apply = ApplyFunction(translate, code_block, scale)  # "Function.Apply"
watch = Watch(apply)
