# Dynamo graph CoreNodeModels.HigherOrder.Combine.dyn (Dynamo 2.17.0.3255)

list_create = List.Create()  # unwired: item0, item1
code_block = CodeBlock { 1..5; }
code_block_2 = CodeBlock { 2..10..#5; }
combine = List.Combine(comb=list_create, list1=code_block, list2=code_block_2)
