# Dynamo graph CoreNodeModels.HigherOrder.ComposeFunctions.dyn (Dynamo 2.17.0.3255)

code_block = CodeBlock { 0..20; }
byCoordinates = Point.ByCoordinates(x=code_block)
code_block_2 = CodeBlock { 7; }
mod = _ % code_block_2  # unwired: x
code_block_3 = CodeBlock { 3; }
div = _ / code_block_3  # unwired: x
compose = ComposeFunctions(function0=mod, function1=div)  # "Function.Compose"
apply = ApplyFunction(function=compose, argument0=code_block)  # "Function.Apply"
watch = Watch(apply)
code_block_4 = CodeBlock { 1; }
add = watch + code_block_4
byCenterPointRadiusNormal = Circle.ByCenterPointRadiusNormal(centerPoint=byCoordinates, radius=add)
