# Dynamo graph CoreNodeModels.HigherOrder.Reduce.dyn (Dynamo 2.17.0.3255)

sub = _ - _  # unwired: x, y
code_block = CodeBlock { 2; 1..4; }
reduce = List.Reduce(reductor=sub, seed=code_block.out0, list1=code_block.out1)
watch = Watch(reduce)
