# Dynamo graph CoreNodeModels.HigherOrder.ScanList.dyn "CoreNodeModels.HigherOrder.ScanList_img" (Dynamo 2.17.0.3255)

add = _ + _  # unwired: x, y
code_block = CodeBlock { 10; }
code_block_2 = CodeBlock { 0..5..1; }
scan = ScanList(reduceFunction=add, seed=code_block, list0=code_block_2)  # "List.Scan"
watch = Watch(scan)
