# Dynamo graph CoreNodeModels.Input.BoolSelector.dyn "Boolean" (Dynamo 2.0.1.5055)

boolean = BoolSelector(true)  # graph input
watch = Watch(boolean)
boolean_2 = BoolSelector(false)  # graph input
watch_2 = Watch(boolean_2)
