# Dynamo graph CoreNodeModels.Input.ColorPalette.dyn (Dynamo 3.5.0.6812)

color_palette = ColorPalette({R: 0, G: 204, B: 204, A: 255})
components = Color.Components(color=color_palette)
watch = Watch(components.alpha)
watch_2 = Watch(components.red)
watch_3 = Watch(components.green)
watch_4 = Watch(components.blue)
