# Dynamo graph CoreNodeModels.Input.CustomSelection.dyn (Dynamo 3.2.1.5376)

custom_selection = CustomSelection("Two", items={One: "1", Two: "2", Three: "3"}, IsVisibleDropDownTextBlock=true)
number_slider = DoubleSlider(15, range=0..100 step 0.1)
mul = custom_selection * number_slider
watch = Watch(mul)
