# Dynamo graph CoreNodeModels.Input.DateTime.dyn "CoreNodeModels.Input.DateTime_img" (Dynamo 2.17.0.3255)

date_time = DateTime("1955-11-05T00:00:00")
watch = Watch(date_time)
date_time_2 = DateTime("2022-11-23T20:41:51.7150446Z")
watch_2 = Watch(date_time_2)
