# Dynamo graph CoreNodeModels.Input.DoubleSlider.dyn "Number Slider" (Dynamo 2.0.1.5055)

number_slider = DoubleSlider(5.536, range=0..10 step 0.001)  # graph input
create_sequence = CodeBlock(x=number_slider) { 0..#8..x; }
watch = Watch(create_sequence)
