# Dynamo graph CoreNodeModels.Input.IntegerSlider64Bit.dyn "Integer Slider" (Dynamo 2.0.1.5055)

number_slider = DoubleSlider(6.011, range=0..10 step 0.001)  # graph input
integer_slider = DoubleSlider(5, range=0..10 step 1)  # graph input
create_interpolated_range = CodeBlock(x=number_slider, y=integer_slider) { 0..x..#y; }
watch = Watch(create_interpolated_range)
