# Dynamo graph CoreNodeModels.Input.StringInput.dyn "String" (Dynamo 2.0.1.5055)

string = StringInput(" ")  # graph input
string_2 = StringInput("Hello")  # graph input
code_block = CodeBlock { "World"; }
join = String.Join(separator=string, string0=string_2, string1=code_block)
watch = Watch(join)
