# Dynamo graph CoreNodeModels.Logic.And.dyn "And" (Dynamo 2.0.1.5055)

boolean = BoolSelector(true)  # graph input
boolean_2 = BoolSelector(false)  # graph input
boolean_3 = BoolSelector(true)  # graph input
and_ = And(bool0=boolean, bool1=boolean_2, bool2=boolean_3)
watch = Watch(and_)
