# Dynamo graph CoreNodeModels.Logic.RefactoredIf.dyn "CoreNodeModels.Logic.RefactoredIf_img" (Dynamo 2.17.0.3255)

integer_slider = IntegerSlider(25, range=0..100 step 1)
randomList = Math.RandomList(amount=integer_slider)
code_block = CodeBlock(x=randomList) { Math.Floor(x*100); }
integer_slider_2 = IntegerSlider(3, range=0..100 step 1)
code_block_2 = CodeBlock(x=code_block, a=integer_slider_2) { x%a==0; }
byCenterPointRadius = Sphere.ByCenterPointRadius()
byLengths = Cuboid.ByLengths()
if_ = RefactoredIf(test=code_block_2, true=byCenterPointRadius, false=byLengths)
code_block_3 = CodeBlock { 2; }
sequence = Sequence(amount=integer_slider, step=code_block_3)
translate = Geometry.Translate(geometry=if_, xTranslation=sequence)
