# Dynamo graph CoreNodeModels.Sequence.dyn "CoreNodeModels.Sequence_img" (Dynamo 2.17.0.3255)

integer_slider = IntegerSlider(1, range=0..100 step 1)
integer_slider_2 = IntegerSlider(25, range=0..100 step 1)
integer_slider_3 = IntegerSlider(2, range=0..100 step 1)
sequence = Sequence(start=integer_slider, amount=integer_slider_2, step=integer_slider_3)
watch = Watch(sequence)
