# Dynamo graph CoreNodeModels.Watch.dyn "CoreNodeModels.Watch_img" (Dynamo 2.17.0.3255)

file_path = Filename("..\..\..\..\..\..\..\..\..\..\Temp\sampleExcel.xlsx")
file_from_path = FileObject(path=file_path)
code_block = CodeBlock { "samplesheet"; false; }
importExcel = Data.ImportExcel(file=file_from_path, sheetName=code_block.out0, showExcel=code_block.out1)
watch = Watch(importExcel)
