# Dynamo graph CoreNodeModels.WatchImageCore.dyn "CoreNodeModels.WatchImageCore_img" (Dynamo 2.17.0.3255)

code_block = CodeBlock { 0..19..1; }
byCoordinates = Point.ByCoordinates(x=code_block, y=code_block, lacing=CrossProduct)
file_path = Filename("..\..\..\..\..\..\..\..\..\..\Temp\samplebitmap.jpg")
file_from_path = FileObject(path=file_path)
readFromFile = Image.ReadFromFile(file=file_from_path)
watch_image = WatchImageCore(image=readFromFile)
code_block_2 = CodeBlock { 20; }
pixels = Image.Pixels(image=watch_image, xSamples=code_block_2, ySamples=code_block_2)
watch = Watch(pixels)
red = Color.Red(color=watch)
code_block_3 = CodeBlock { 500; }
div = red / code_block_3
byCenterPointRadius = Circle.ByCenterPointRadius(centerPoint=byCoordinates, radius=div)
