# Dynamo graph CoreNodeModels.WebRequest.dyn "CoreNodeModels.WebRequest_img" (Dynamo 2.17.0.3255)

code_block = CodeBlock { "http://www.google.com"; }
web_request = WebRequest(url=code_block)
watch = Watch(web_request)
