# Dynamo graph CoreNodeModelsWpf.Charts.BarChartNodeModel.dyn "CoreNodeModelsWpf.Charts.BarChart" (Dynamo 2.18.0.3514)

code_block = CodeBlock { ["January", "February", "March"]; [[4, 12, 34],[14, 22, 14],[15, 3, 6]]; }
color_palette = ColorPalette({R: 255, G: 20, B: 147, A: 255})
color_palette_2 = ColorPalette({R: 186, G: 85, B: 211, A: 255})
color_palette_3 = ColorPalette({R: 135, G: 206, B: 250, A: 255})
list_create = List.Create(item0=color_palette, item1=color_palette_2, item2=color_palette_3)
bar_chart = BarChartNodeModel(labels=code_block.out0, values=code_block.out1, colors=list_create, Labels=["January", "February", "March"], Values=[[4, 12, 34], [14, 22, 14], [15, 3, 6]], Colors=["#FFFF1493", "#FFBA55D3", "#FF87CEFA"])
