# Dynamo graph D37XBKNJBX5AZGHXPUHHK5DDGNDHLDGPI2QPK63TZHRZVREQ6MNA.dyn "ByCoordinates" (Dynamo 2.0.1.5055)

code_block = CodeBlock { 2; }
boolean = BoolSelector(false)  # graph input
byCoordinates = Vector.ByCoordinates(x=code_block, y=code_block, normalized=boolean)
length = Vector.Length(vector=byCoordinates)
watch = Watch(length)
origin = Point.Origin()
byStartPointDirectionLength = Line.ByStartPointDirectionLength(startPoint=origin, direction=byCoordinates, length=length)
