# Dynamo graph D6ESVRBW5SSM4F7J65W7OKR5DTKJAFW5F5AP23FRRR3MGXKIFVOQ.dyn "Autodesk.DesignScript.Geometry.TSpline.TSplineSurface.UnweldVertices" (Dynamo 2.19.3.6543)

code_block = CodeBlock { 20; }
byCoordinates = Point.ByCoordinates(x=code_block, y=code_block)
code_block_2 = CodeBlock { 3; }
boolean = BoolSelector(true)
byPlaneOriginNormal = TSpline.TSplineSurface.ByPlaneOriginNormal(maxCorner=byCoordinates, xSpans=code_block_2, ySpans=code_block_2, inSmoothMode=boolean)
code_block_3 = CodeBlock { 4; }
vertexByIndex = TSpline.TSplineTopology.VertexByIndex(tSplineTopology=byPlaneOriginNormal, index=code_block_3)
unweldVertices = TSpline.TSplineSurface.UnweldVertices(tSplineSurface=byPlaneOriginNormal, vertices=vertexByIndex)
code_block_4 = CodeBlock { [4,5]; }
vertexByIndex_2 = TSpline.TSplineTopology.VertexByIndex(tSplineTopology=unweldVertices, index=code_block_4)
code_block_5 = CodeBlock { 3; }
byCoordinates_2 = Vector.ByCoordinates(z=code_block_5)
moveVertices = TSpline.TSplineSurface.MoveVertices(tSplineSurface=unweldVertices, vertices=vertexByIndex_2, vector=byCoordinates_2)
