# Dynamo graph D7TPJG7RLZUUPHJENWETOGTAX7U3ZWFXG4BAAHEGVXCRSUW3IVCQ.dyn "Autodesk.DesignScript.Geometry.CoordinateSystem.Translate" (Dynamo 2.19.0.5742)

byOrigin = CoordinateSystem.ByOrigin()
number_slider = DoubleSlider(3.1, range=0..5 step 0.1)  # graph input
number_slider_2 = DoubleSlider(4.1, range=0..5 step 0.1)  # graph input
byCoordinates = Vector.ByCoordinates(x=number_slider, y=number_slider_2)
number_slider_3 = DoubleSlider(3, range=0..4 step 0.1)  # graph input
translate = CoordinateSystem.Translate(coordinateSystem=byOrigin, direction=byCoordinates, distance=number_slider_3)
byRadiusHeight = Cylinder.ByRadiusHeight(coordinateSystem=translate)
color_palette = ColorPalette({R: 100, G: 141, B: 198, A: 164})
byGeometryColor = Modifiers.GeometryColor.ByGeometryColor(geometry=byRadiusHeight, color=color_palette)
