# Dynamo graph DSCore.Color.ByARGB.dyn "ByARGB" (Dynamo 2.0.1.5055)

byLengths = Cuboid.ByLengths()
number_slider = DoubleSlider(255, range=0..255 step 1)  # graph input
number_slider_2 = DoubleSlider(109, range=0..255 step 1)  # graph input
number_slider_3 = DoubleSlider(203, range=0..255 step 1)  # graph input
number_slider_4 = DoubleSlider(157, range=0..255 step 1)  # graph input
byARGB = Color.ByARGB(a=number_slider, r=number_slider_2, g=number_slider_3, b=number_slider_4)
byGeometryColor = Modifiers.GeometryColor.ByGeometryColor(geometry=byLengths, color=byARGB)
