# Dynamo graph DSCore.Data.StringifyJSON.dyn "Data.StringifyJSON" (Dynamo 2.13.1.3887)

code_block = CodeBlock { "A".."D"; 0..3; }
byKeysValues = DesignScript.Builtin.Dictionary.ByKeysValues(keys=code_block.out0, values=code_block.out1)
stringifyJSON = Data.StringifyJSON(values=byKeysValues)
watch = Watch(stringifyJSON)
