# Dynamo graph DSCore.DateTime.AddTimeSpan.dyn "AddTimeSpan" (Dynamo 2.0.1.5055)

now = DateTime.Now()
code_block = CodeBlock { 1; }
code_block_2 = CodeBlock { 8; }
create = TimeSpan.Create(days=code_block, hours=code_block_2)
addTimeSpan = DateTime.AddTimeSpan(dateTime=now, timeSpan=create)
watch = Watch(addTimeSpan)
