# Dynamo graph DSCore.DateTime.ByDate.dyn "ByDate" (Dynamo 2.0.1.5055)

code_block = CodeBlock { 2006; }
code_block_2 = CodeBlock { 8; }
code_block_3 = CodeBlock { 8; }
byDate = DateTime.ByDate(year=code_block, month=code_block_2, day=code_block_3)
watch = Watch(byDate)
