# Dynamo graph DSCore.DateTime.Components.dyn "Components" (Dynamo 2.0.1.5055)

now = DateTime.Now()
components = DateTime.Components(dateTime=now)
watch = Watch(components.year)
watch_2 = Watch(components.month)
watch_3 = Watch(components.day)
watch_4 = Watch(components.hour)
