# Dynamo graph DSCore.DateTime.DayOfWeek.dyn "DayOfWeek" (Dynamo 2.0.1.5055)

code_block = CodeBlock { 2006; }
code_block_2 = CodeBlock { 8; }
code_block_3 = CodeBlock { 8; }
code_block_4 = CodeBlock { 16; }
code_block_5 = CodeBlock { 24; }
byDateAndTime = DateTime.ByDateAndTime(year=code_block, month=code_block_2, day=code_block_3, hour=code_block_4, minute=code_block_5)
dayOfWeek = DateTime.DayOfWeek(dateTime=byDateAndTime)
watch = Watch(dayOfWeek)
