# Dynamo graph DSCore.DateTime.Format.dyn (Dynamo 2.17.0.3255)

date_time = DateTime("2015-03-14T21:26:00Z")  # graph input
code_block = CodeBlock { "yyyyddMM"; }
format = DateTime.Format(dateTime=date_time, format=code_block)
