# Dynamo graph DSCore.DateTime.IsDaylightSavingsTime.dyn "IsDaylightSavingsTime" (Dynamo 2.0.1.5055)

code_block = CodeBlock { "November 14, 2016 12:36 PM"; }
fromString = DateTime.FromString(str=code_block)
isDaylightSavingsTime = DateTime.IsDaylightSavingsTime(dateTime=fromString)
watch = Watch(isDaylightSavingsTime)
