# Dynamo graph DSCore.DateTime.SubtractTimeSpan.dyn "SubtractTimeSpan" (Dynamo 2.0.1.5055)

now = DateTime.Now()
code_block = CodeBlock { 1; }
code_block_2 = CodeBlock { 8; }
create = TimeSpan.Create(days=code_block, hours=code_block_2)
subtractTimeSpan = DateTime.SubtractTimeSpan(dateTime=now, timeSpan=create)
watch = Watch(subtractTimeSpan)
