# Dynamo graph DSCore.IO.FileSystem.AppendText.dyn "DSCore.IO.FileSystem.AppendText_img" (Dynamo 2.17.0.3255)

file_path = Filename("..\..\..\..\..\..\..\..\..\..\Temp\Sample.txt")
code_block = CodeBlock { "textToAppend"; }
appendText = FileSystem.AppendText(filePath=file_path, text=code_block)
