# Dynamo graph DSCore.IO.FileSystem.ChangePathExtension.dyn "DSCore.IO.FileSystem.ChangePathExtension_img" (Dynamo 2.17.0.3255)

file_path = Filename("..\..\..\..\..\..\..\..\..\..\Temp\Sample.txt")
code_block = CodeBlock { "exp"; }
changePathExtension = FileSystem.ChangePathExtension(path=file_path, newExtension=code_block)
watch = Watch(changePathExtension)
