# Dynamo graph DSCore.IO.FileSystem.CombinePath.dyn "DSCore.IO.FileSystem.CombinePath_img" (Dynamo 2.17.0.3255)

file_path = Filename("..\..\..\..\..\..\..\..\..\..\Temp\sample.sat")
directory_path = Directory("C:\Users\dneno\OneDrive\Desktop\Export")
fileName = FileSystem.FileName(path=file_path)
combinePath = FileSystem.CombinePath(string0=directory_path, string1=fileName)
moveFile = FileSystem.MoveFile(path=file_path, newPath=combinePath)
