# Dynamo graph DSCore.IO.FileSystem.CopyDirectory.dyn "DSCore.IO.FileSystem.CopyDirectory_img" (Dynamo 2.17.0.3255)

directory_path = Directory("C:\Temp\NewFolder")
directory_from_path = DirectoryObject(path=directory_path)
directory_path_2 = Directory("C:\Temp\NewFolder2")
copyDirectory = FileSystem.CopyDirectory(directory=directory_from_path, destinationPath=directory_path_2)
