# Dynamo graph DSCore.IO.FileSystem.DirectoryExists.dyn "DSCore.IO.FileSystem.DirectoryExists_img" (Dynamo 2.17.0.3255)

directory_path = Directory("C:\Temp\NewFolder")
directoryExists = FileSystem.DirectoryExists(path=directory_path)
watch = Watch(directoryExists)
