# Dynamo graph DSCore.IO.FileSystem.FileHasExtension.dyn "DSCore.IO.FileSystem.FileHasExtension_img" (Dynamo 2.17.0.3255)

file_path = Filename("..\..\..\..\..\..\..\..\..\..\Temp\sample.txt")
fileHasExtension = FileSystem.FileHasExtension(path=file_path)
watch = Watch(fileHasExtension)
