# Dynamo graph DSCore.IO.FileSystem.MoveDirectory.dyn "DSCore.IO.FileSystem.MoveDirectory_img" (Dynamo 2.17.0.3255)

directory_path = Directory("C:\Temp\NewFolder")
code_block = CodeBlock { "C:\\Temp\\NewFolder2"; }
moveDirectory = FileSystem.MoveDirectory(path=directory_path, newPath=code_block)
