# Dynamo graph DSCore.IO.Image.Dimensions.dyn "DSCore.IO.Image.Dimensions_img" (Dynamo 2.17.0.3255)

file_path = Filename("..\..\..\..\..\..\..\..\..\..\Temp\sample.png")
file_from_path = FileObject(path=file_path)
readFromFile = Image.ReadFromFile(file=file_from_path)
dimensions = Image.Dimensions(image=readFromFile)
watch = Watch(dimensions.width)
watch_2 = Watch(dimensions.height)
