# Dynamo graph DSCore.IO.Image.FromPixels(colors).dyn "DSCore.IO.Image.FromPixels(colors)_img" (Dynamo 2.17.0.3255)

code_block = CodeBlock { 0..255..1; }
byARGB = Color.ByARGB(red=code_block, green=code_block, lacing=CrossProduct)
fromPixels = Image.FromPixels(colors=byARGB)
watch_image = WatchImageCore(image=fromPixels)
