# Dynamo graph DSCore.IO.Image.FromPixels(colors, width, height).dyn "DSCore.IO.Image.FromPixels(colors, width, height)_img" (Dynamo 2.17.0.3255)

code_block = CodeBlock { 0..255..1; }
byARGB = Color.ByARGB(red=code_block, green=code_block)
code_block_2 = CodeBlock { 8; }
count = List.Count(list=byARGB)
div = count / code_block_2
fromPixels = Image.FromPixels(colors=byARGB, width=code_block_2, height=div)
watch_image = WatchImageCore(image=fromPixels)
