# Dynamo graph DSCore.IO.Image.ReadFromFile.dyn "DSCore.IO.Image.ReadFromFile_img" (Dynamo 2.17.0.3255)

file_path = Filename("..\..\..\..\..\..\..\..\..\..\Temp\dynamo_logo_dark-trim.jpg")
file_from_path = FileObject(path=file_path)
readFromFile = Image.ReadFromFile(file=file_from_path)
watch_image = WatchImageCore(image=readFromFile)
