# Dynamo graph DSCore.List.AddItemToEnd.dyn (Dynamo 2.19.0.5742)

code_block = CodeBlock { 20; }
code_block_2 = CodeBlock { 0..5..1; }
watch = Watch(code_block_2)
addItemToEnd = List.AddItemToEnd(item=code_block, list=watch)
watch_2 = Watch(addItemToEnd)
