# Dynamo graph DSCore.List.AddItemToFront.dyn (Dynamo 2.19.0.5742)

code_block = CodeBlock { 20; }
code_block_2 = CodeBlock { 0..5..1; }
watch = Watch(code_block_2)
addItemToFront = List.AddItemToFront(item=code_block, list=watch)
watch_2 = Watch(addItemToFront)
