# Dynamo graph DSCore.List.AllFalse.dyn (Dynamo 2.19.0.5742)

boolean = BoolSelector(false)  # graph input
boolean_2 = BoolSelector(true)  # graph input
create = List.Create(item0=boolean, item1=boolean_2)
watch = Watch(create)
allFalse = List.AllFalse(list=watch)
watch_2 = Watch(allFalse)
create_2 = List.Create(item0=boolean, item1=boolean)
watch_3 = Watch(create_2)
allFalse_2 = List.AllFalse(list=watch_3)
watch_4 = Watch(allFalse_2)
create_3 = List.Create(item0=create, item1=create_2)
watch_5 = Watch(create_3)
allFalse_3 = List.AllFalse(list=watch_5)
watch_6 = Watch(allFalse_3)
allFalse_4 = List.AllFalse(list=watch_5@L2)
watch_7 = Watch(allFalse_4)
