# Dynamo graph DSCore.List.AllIndicesOf.dyn (Dynamo 2.19.0.5742)

code_block = CodeBlock { ["A", "B", "C", "D", "B", "A", "D"]; }
code_block_2 = CodeBlock { "B"; }
allIndicesOf = List.AllIndicesOf(list=code_block, item=code_block_2)
