# Dynamo graph DSCore.List.Chop.dyn (Dynamo 2.19.0.5742)

code_block = CodeBlock { 0..5..1; }
watch = Watch(code_block)
code_block_2 = CodeBlock { [1,3]; }
chop = List.Chop(list=watch, lengths=code_block_2)
watch_2 = Watch(chop)
