# Dynamo graph DSCore.List.Clean.dyn (Dynamo 2.19.0.5742)

code_block = CodeBlock { [10, 4, null, 40, A]; }  # unwired: A
watch = Watch(code_block)
boolean = BoolSelector(false)  # graph input
clean = List.Clean(list=watch, preserveIndices=boolean)
watch_2 = Watch(clean)
