# Dynamo graph DSCore.List.Combinations.dyn (Dynamo 2.19.0.5742)

code_block = CodeBlock { 0..5..1; }
watch = Watch(code_block)
code_block_2 = CodeBlock { 3; }
boolean = BoolSelector(true)  # graph input
combinations = List.Combinations(list=watch, length=code_block_2, replace=boolean)
watch_2 = Watch(combinations)
