# Dynamo graph DSCore.List.CountFalse.dyn (Dynamo 2.19.0.5742)

boolean = BoolSelector(false)  # graph input
boolean_2 = BoolSelector(true)  # graph input
create = List.Create(item0=boolean, item1=boolean_2)
create_2 = List.Create(item0=boolean, item1=boolean)
create_3 = List.Create(item0=create, item1=create_2)
watch = Watch(create_3)
countFalse = List.CountFalse(list=watch@L2, lacing=Shortest)
watch_2 = Watch(countFalse)
countFalse_2 = List.CountFalse(list=watch@L3, lacing=Shortest)
watch_3 = Watch(countFalse_2)
countFalse_3 = List.CountFalse(list=watch, lacing=Longest)
watch_4 = Watch(countFalse_3)
watch_5 = Watch(create_2)
countFalse_4 = List.CountFalse(list=watch_5, lacing=Shortest)
watch_6 = Watch(countFalse_4)
watch_7 = Watch(create)
countFalse_5 = List.CountFalse(list=watch_7, lacing=Shortest)
watch_8 = Watch(countFalse_5)
