# Dynamo graph DSCore.List.CountTrue.dyn (Dynamo 2.19.0.5742)

boolean = BoolSelector(false)  # graph input
boolean_2 = BoolSelector(true)  # graph input
create = List.Create(item0=boolean, item1=boolean_2)
create_2 = List.Create(item0=boolean, item1=boolean)
create_3 = List.Create(item0=create, item1=create_2)
watch = Watch(create_3)
countTrue = List.CountTrue(list=watch@L2, lacing=Shortest)
watch_2 = Watch(countTrue)
countTrue_2 = List.CountTrue(list=watch@L3, lacing=Shortest)
watch_3 = Watch(countTrue_2)
countTrue_3 = List.CountTrue(list=watch, lacing=Shortest)
watch_4 = Watch(countTrue_3)
watch_5 = Watch(create_2)
countTrue_4 = List.CountTrue(list=watch_5, lacing=Shortest)
watch_6 = Watch(countTrue_4)
watch_7 = Watch(create)
countTrue_5 = List.CountTrue(list=watch_7, lacing=Shortest)
watch_8 = Watch(countTrue_5)
