# Dynamo graph DSCore.List.Deconstruct.dyn (Dynamo 2.19.0.5742)

code_block = CodeBlock { 0..5..1; }
watch = Watch(code_block)
deconstruct = List.Deconstruct(list=watch)
watch_2 = Watch(deconstruct.first)
watch_3 = Watch(deconstruct.rest)
