# Dynamo graph DSCore.List.DropEveryNthItem.dyn (Dynamo 2.19.0.5742)

integer_slider = IntegerSlider(1, range=0..100 step 1)  # graph input
integer_slider_2 = IntegerSlider(25, range=0..100 step 1)  # graph input
integer_slider_3 = IntegerSlider(2, range=0..100 step 1)  # graph input
range = Range(start=integer_slider, end=integer_slider_2, step=integer_slider_3, lacing=Longest)
watch = Watch(range)
integer_slider_4 = IntegerSlider(2, range=-10..10 step 1)  # graph input
dropEveryNthItem = List.DropEveryNthItem(list=watch, n=integer_slider_4)
watch_2 = Watch(dropEveryNthItem)
