# Dynamo graph DSCore.List.FilterByBoolMask.dyn (Dynamo 2.19.0.5742)

code_block = CodeBlock()
# ---------- code_block.designscript (11 lines) ----------
data = [
		"Marble",
		"Quartz",
		"Wood",
		"Porcelain",
		"Stone",
		"Quartz",
		"Stone",
		"Wood",
		"Laminate"
];
# ----------------------------------------
code_block_2 = CodeBlock { "Wood"; "Laminate"; }
eq = code_block == code_block_2.out0
eq_2 = code_block == code_block_2.out1
# note: "Or" operator that checks if any condition coming in is True.
or_ = eq || eq_2
filterByBoolMask = List.FilterByBoolMask(list=code_block, mask=or_)
