# Dynamo graph DSCore.List.FirstIndexOf.dyn (Dynamo 2.19.0.5742)

code_block = CodeBlock { 10; }
randomList = Math.RandomList(amount=code_block)
code_block_2 = CodeBlock(x=randomList) { x*5; }
floor = Math.Floor(number=code_block_2)
watch = Watch(floor)
code_block_3 = CodeBlock { 1; }
firstIndexOf = List.FirstIndexOf(list=watch, item=code_block_3)
watch_2 = Watch(firstIndexOf)
