# Dynamo graph DSCore.List.FirstItem.dyn (Dynamo 2.19.0.5742)

code_block = CodeBlock { 1..10..1; }
shuffle = List.Shuffle(list=code_block)
code_block_2 = CodeBlock { 1..10..1; }
shuffle_2 = List.Shuffle(list=code_block_2)
code_block_3 = CodeBlock { 1..10..1; }
shuffle_3 = List.Shuffle(list=code_block_3)
list_create = List.Create(item0=shuffle, item1=shuffle_2, item2=shuffle_3)
watch = Watch(list_create)
firstItem = List.FirstItem(list=watch@L3)
watch_2 = Watch(firstItem)
