# Dynamo graph DSCore.List.GroupByKey.dyn (Dynamo 2.19.0.5742)

code_block = CodeBlock { 0..9..1; }
code_block_2 = CodeBlock { 10; }
randomList = Math.RandomList(amount=code_block_2)
code_block_3 = CodeBlock(x=randomList) { x*5; }
floor = Math.Floor(number=code_block_3)
watch = Watch(floor)
groupByKey = List.GroupByKey(list=code_block, keys=watch)
watch_2 = Watch(groupByKey.groups)
