# Dynamo graph DSCore.List.GroupBySimilarity.dyn (Dynamo 3.5.0.8100)

# group: Group lists by similarity > Cluster list of strings by similarity
strings = CodeBlock { ["Room","room","rooms","gate","Gate","gates","Room A","room A", "Level","level","Leval"]; }
# note: The tolerance input lets users define the threshold value for grouping similar elements.  For string lists, it represents the maximum number of characters that can differ between two strings, using Levenshtein distance for comparison.
# Maximum tolerance for strings is set to 5.
tolerance = CodeBlock { 2; }
consider_adjacency = BoolSelector(false)
groupBySimilarity = List.GroupBySimilarity(list=strings, tolerance=tolerance, considerAdjacency=consider_adjacency)
clustered_list = Watch(groupBySimilarity.groupedValues)
list_of_index = Watch(groupBySimilarity.groupedIndices)

# group: Group lists by similarity > Cluster list of number by adjacency and similarity
numbers = CodeBlock { [1.10012, 1.1516, 1.13189, 2.1011, 2.1125, 4.1256, 4.2089, 4.2321, 5.30]; }
# note: The tolerance input lets users define the threshold value for grouping similar elements. For numeric lists, the tolerance value represents the allowable difference between two numbers.
code_block = CodeBlock { 0.2; }
consider_adjacency_2 = BoolSelector(true)
groupBySimilarity_2 = List.GroupBySimilarity(list=numbers, tolerance=code_block, considerAdjacency=consider_adjacency_2)
clustered_list_2 = Watch(groupBySimilarity_2.groupedValues)
list_of_index_2 = Watch(groupBySimilarity_2.groupedIndices)
