# Dynamo graph DSCore.List.Insert.dyn (Dynamo 2.19.0.5742)

code_block = CodeBlock { 0..12..#6; }
watch = Watch(code_block)
code_block_2 = CodeBlock { "Hello"; "List!"; }
create = List.Create(item0=code_block_2.out0, item1=code_block_2.out1)
code_block_3 = CodeBlock { 2; }
insert = List.Insert(list=code_block, element=create, index=code_block_3)
watch_2 = Watch(insert)
