# Dynamo graph DSCore.List.IsHomogeneous.dyn (Dynamo 2.19.0.5742)

code_block = CodeBlock { 0..12..#6; }
code_block_2 = CodeBlock { "a string"; }
code_block_3 = CodeBlock { 2; }
insert = List.Insert(list=code_block, element=code_block_2, index=code_block_3)
watch = Watch(insert)
isHomogeneous = List.IsHomogeneous(list=watch)
watch_2 = Watch(isHomogeneous)
watch_3 = Watch(code_block)
isHomogeneous_2 = List.IsHomogeneous(list=watch_3)
watch_4 = Watch(isHomogeneous_2)
