# Dynamo graph DSCore.List.Join.dyn "Dynamo.Graph.Nodes.ZeroTouch.DSVarArgFunction" (Dynamo 2.19.0.5742)

code_block = CodeBlock { 1..5..2; }
watch = Watch(code_block)
code_block_2 = CodeBlock { 0..4..2; }
watch_2 = Watch(code_block_2)
join = List.Join(list0=watch, list1=watch_2)
watch_3 = Watch(join)
