# Dynamo graph DSCore.List.LastItem.dyn (Dynamo 2.19.0.5742)

code_block = CodeBlock { 10; }
randomList = Math.RandomList(amount=code_block)
code_block_2 = CodeBlock(x=randomList) { x*5; }
floor = Math.Floor(number=code_block_2)
watch = Watch(floor)
lastItem = List.LastItem(list=watch)
watch_2 = Watch(lastItem)
