# Dynamo graph DSCore.List.MinimumItem.dyn (Dynamo 2.19.0.5742)

code_block = CodeBlock { 10; }
randomList = Math.RandomList(amount=code_block)
code_block_2 = CodeBlock(x=randomList) { x*50; }
floor = Math.Floor(number=code_block_2)
watch = Watch(floor)
minimumItem = List.MinimumItem(list=watch)
watch_2 = Watch(minimumItem)
