# Dynamo graph DSCore.List.NormalizeDepth.dyn (Dynamo 2.19.0.5742)

code_block = CodeBlock { 0..12..#6; }
create = List.Create(item0=code_block, item1=code_block)
create_2 = List.Create(item0=code_block, item1=create)
watch = Watch(create_2)
integer_slider = IntegerSlider(3, range=0..100 step 1)
normalizeDepth = List.NormalizeDepth(list=watch, rank=integer_slider, lacing=Shortest)
watch_2 = Watch(normalizeDepth)
