# Dynamo graph DSCore.List.OfRepeatedItem.dyn (Dynamo 2.19.0.5742)

code_block = CodeBlock { 4; }
code_block_2 = CodeBlock { 10; }
ofRepeatedItem = List.OfRepeatedItem(item=code_block, amount=code_block_2)
watch = Watch(ofRepeatedItem)
