# Dynamo graph DSCore.List.RemoveItemAtIndex.dyn (Dynamo 2.19.0.5742)

code_block = CodeBlock { 0..5..1; }
watch = Watch(code_block)
code_block_2 = CodeBlock { 3; }
removeItemAtIndex = List.RemoveItemAtIndex(list=watch, indices=code_block_2)
watch_2 = Watch(removeItemAtIndex)
