# Dynamo graph DSCore.List.ReplaceItemAtIndex.dyn (Dynamo 2.19.0.5742)

code_block = CodeBlock { 0..5..1; }
watch = Watch(code_block)
code_block_2 = CodeBlock { 3; }
code_block_3 = CodeBlock { 10; }
replaceItemAtIndex = List.ReplaceItemAtIndex(list=watch, index=code_block_2, item=code_block_3)
watch_2 = Watch(replaceItemAtIndex)
