# Dynamo graph DSCore.List.ReplaceItemAtIndices.dyn (Dynamo 3.5.0.7755)

code_block = CodeBlock { 0..5..1; }
watch = Watch(code_block)
code_block_2 = CodeBlock { 3; 5; }
list_create = List.Create(item0=code_block_2.out0, item1=code_block_2.out1)
code_block_3 = CodeBlock { 10; }
replaceItemAtIndices = List.ReplaceItemAtIndices(list=watch, indices=list_create, item=code_block_3)
watch_2 = Watch(replaceItemAtIndices)
