# Dynamo graph DSCore.List.Sort.dyn (Dynamo 2.19.0.5742)

integer_slider = IntegerSlider(25, range=0..100 step 1)  # graph input
randomList = Math.RandomList(amount=integer_slider)
code_block = CodeBlock(x=randomList) { x*10; }
floor = Math.Floor(number=code_block)
watch = Watch(floor)
sort = List.Sort(list=watch)
watch_2 = Watch(sort)
