# Dynamo graph DSCore.List.SortIndexByValue.dyn (Dynamo 2.19.0.5742)

code_block = CodeBlock { 10; }
randomList = Math.RandomList(amount=code_block)
code_block_2 = CodeBlock(x=randomList) { x*10; }
watch = Watch(code_block_2)
sortIndexByValue = List.SortIndexByValue(list=watch)
watch_2 = Watch(sortIndexByValue)
