# Dynamo graph DSCore.List.TakeItems.dyn (Dynamo 2.19.0.5742)

code_block = CodeBlock { 0..9..1; }
integer_slider = IntegerSlider(4, range=0..10 step 1)  # graph input
takeItems = List.TakeItems(list=code_block, amount=integer_slider)
watch = Watch(takeItems)
