# Dynamo graph DSCore.List.Transpose.dyn (Dynamo 2.19.0.5742)

code_block = CodeBlock { numbers = 0..5; letters = "A".."E"; }
list_create = List.Create(item0=code_block.numbers, item1=code_block.letters)
transpose = List.Transpose(lists=list_create)
