# Dynamo graph DSCore.Math.Atan2.dyn (Dynamo 1.0.0.1180)

number_slider = DoubleSlider(10.6, range=-100..100 step 0.1)
number_slider_2 = DoubleSlider(47.5, range=-100..100 step 0.1)
atan2 = Math.Atan2(number_slider, number_slider_2)
watch = Watch(atan2)
