# Dynamo graph DSCore.Math.DegreesToRadians.dyn (Dynamo 2.19.0.5742)

number_slider = DoubleSlider(155, range=-360..360 step 1)  # graph input
degreesToRadians = Math.DegreesToRadians(degrees=number_slider)
watch = Watch(degreesToRadians)
