# Dynamo graph DSCore.Math.Log(number, logBase).dyn (Dynamo 1.0.0.1180)

number_slider = DoubleSlider(64, range=0..100 step 0.1)
number_slider_2 = DoubleSlider(2, range=0..100 step 0.1)
log = Math.Log(number_slider, number_slider_2)
watch = Watch(log)
