# Dynamo graph DSCore.Math.Map.dyn (Dynamo 1.1.0.2093)

code_block = CodeBlock { 2; }
code_block_2 = CodeBlock { 6; }
code_block_3 = CodeBlock { 4; }
map = Map(code_block, code_block_2, code_block_3)
watch = Watch(map)
