# Dynamo graph DSCore.Math.MapTo.dyn (Dynamo 1.1.0.2093)

code_block = CodeBlock { 2; 4; }
number_slider = DoubleSlider(4, range=2..4 step 0.1)
code_block_2 = CodeBlock { 20; 100; }
mapTo = MapTo(code_block.out0, code_block.out1, number_slider, code_block_2.out0, code_block_2.out1)
watch = Watch(mapTo)
