# Dynamo graph DSCore.Math.Max(int1, int2).dyn (Dynamo 1.0.0.1180)

integer_slider = IntegerSlider(23, range=0..100 step 1)
integer_slider_2 = IntegerSlider(50, range=0..100 step 1)
max = Math.Max(integer_slider, integer_slider_2)
watch = Watch(max)
