# Dynamo graph DSCore.Math.Max(value1, value2).dyn (Dynamo 1.0.0.1180)

number_slider = DoubleSlider(23.9, range=0..100 step 0.1)
number_slider_2 = DoubleSlider(58.8, range=0..100 step 0.1)
max = Math.Max(value1=number_slider, value2=number_slider_2)
watch = Watch(max)
