# Dynamo graph DSCore.Math.RadiansToDegrees.dyn (Dynamo 1.0.0.1180)

number_slider = DoubleSlider(3.56, range=-10..10 step 0.01)
radiansToDegrees = Math.RadiansToDegrees(number_slider)
watch = Watch(radiansToDegrees)
