# Dynamo graph DSCore.Math.Random(value1, value2, seed).dyn "Math.Random2" (Dynamo 2.13.1.3887)

number_slider = DoubleSlider(1, range=0..100 step 0.1)
number_slider_2 = DoubleSlider(42.1, range=0..100 step 0.1)
number_slider_3 = DoubleSlider(1, range=0..100 step 0.1)
random = Math.Random(value1=number_slider, value2=number_slider_2, seed=number_slider_3)
watch = Watch(random)
