# Dynamo graph DSCore.Math.Round(number, digits).dyn (Dynamo 1.0.0.1180)

rand = Math.Rand()
integer_slider = IntegerSlider(5, range=0..10 step 1)
round = Math.Round(number=rand, digits=integer_slider)
watch = Watch(round)
