# Dynamo graph DSCore.Object.Identity.dyn "Identity" (Dynamo 2.0.1.5055)

code_block = CodeBlock()
# ---------- code_block.designscript (5 lines) ----------
pt=Point.ByCoordinates(4,0);

circle=Circle.ByCenterPointRadius(Point.ByCoordinates(-2,0));

sphere=Sphere.ByCenterPointRadius(Point.ByCoordinates(1,0));
# ----------------------------------------
identity = Object.Identity(obj=code_block.pt)
identity_2 = Object.Identity(obj=code_block.circle)
identity_3 = Object.Identity(obj=code_block.sphere)
