# Dynamo graph DSCore.Object.IsNull.dyn "IsNull" (Dynamo 2.0.1.5055)

code_block = CodeBlock { "A".."F"; }
code_block_2 = CodeBlock { 8; }
randomList = Math.RandomList(amount=code_block_2)
code_block_3 = CodeBlock { 0; 9; }
remapRange = Math.RemapRange(numbers=randomList, newMin=code_block_3.out0, newMax=code_block_3.out1)
floor = Math.Floor(number=remapRange)
getItemAtIndex = List.GetItemAtIndex(list=code_block, index=floor)
isNull = Object.IsNull(obj=getItemAtIndex)
