# Dynamo graph DSCore.String.AllIndicesOf.dyn "AllIndicesOf" (Dynamo 2.0.1.5055)

string = StringInput("The quick brown fox jumps over the lazy dog")
code_block = CodeBlock { "o"; }
allIndicesOf = String.AllIndicesOf(str=string, searchFor=code_block)
