# Dynamo graph DSCore.String.ChangeCase.dyn "ChangeCase" (Dynamo 2.0.1.5055)

string = StringInput("Hello World")  # graph input
boolean = BoolSelector(true)  # graph input
changeCase = String.ChangeCase(str=string, upper=boolean)
watch = Watch(changeCase)
