# Dynamo graph DSCore.String.Contains.dyn "Contains" (Dynamo 2.0.1.5055)

string = StringInput("Hello World")  # graph input
string_2 = StringInput("E")  # graph input
boolean = BoolSelector(true)  # graph input
contains = String.Contains(str=string, searchFor=string_2, ignoreCase=boolean)
watch = Watch(contains)
