# Dynamo graph DSCore.String.CountOccurrences.dyn "CountOccurrences" (Dynamo 2.0.1.5055)

string = StringInput("Hello World")  # graph input
string_2 = StringInput("L")  # graph input
boolean = BoolSelector(true)  # graph input
countOccurrences = String.CountOccurrences(str=string, searchFor=string_2, ignoreCase=boolean)
watch = Watch(countOccurrences)
