# Dynamo graph DSCore.String.GetNumber.dyn "String.GetNumber" (Dynamo 2.14.0.3835)

string = StringInput("i need about 350")
getNumber = String.GetNumber(string=string)
watch = Watch(getNumber)
type = Object.Type(object=getNumber)
watch_2 = Watch(type)
