# Dynamo graph DSCore.String.Remove.dyn "Remove" (Dynamo 2.0.1.5055)

string = StringInput("Hello World")  # graph input
integer_slider = IntegerSlider(4, range=0..10 step 1)  # graph input
integer_slider_2 = IntegerSlider(3, range=0..10 step 1)  # graph input
remove = String.Remove(str=string, startIndex=integer_slider, count=integer_slider_2)
watch = Watch(remove)
