# Dynamo graph DSCore.String.Replace.dyn "Replace" (Dynamo 2.0.1.5055)

string = StringInput("Hello World")  # graph input
string_2 = StringInput("o")  # graph input
string_3 = StringInput("Hi!")  # graph input
replace = String.Replace(str=string, searchFor=string_2, replaceWith=string_3)
watch = Watch(replace)
