# Dynamo graph DSCore.String.TrimTrailingWhitespace.dyn "TrimTrailingWhitespace" (Dynamo 2.0.1.5055)

string = StringInput("      Hello World      ")  # graph input
trimLeadingWhitespace = String.TrimLeadingWhitespace(str=string)
watch = Watch(trimLeadingWhitespace)
string_2 = StringInput("      Hello World      ")  # graph input
trimTrailingWhitespace = String.TrimTrailingWhitespace(str=string_2)
watch_2 = Watch(trimTrailingWhitespace)
string_3 = StringInput("      Hello World      ")  # graph input
trimWhitespace = String.TrimWhitespace(str=string_3)
watch_3 = Watch(trimWhitespace)
