# Dynamo graph DSCore.TimeSpan.Add.dyn "Add" (Dynamo 2.0.1.5055)

code_block = CodeBlock { 10; }
create = TimeSpan.Create(days=code_block)
code_block_2 = CodeBlock { 5; }
create_2 = TimeSpan.Create(hours=code_block_2)
add = TimeSpan.Add(timeSpan1=create, timeSpan2=create_2)
watch = Watch(add)
