# Dynamo graph DSCore.TimeSpan.Components.dyn "Components" (Dynamo 2.0.1.5055)

code_block = CodeBlock { "5:6:21"; }
fromString = TimeSpan.FromString(str=code_block)
components = TimeSpan.Components(timeSpan=fromString)
watch = Watch(components.days)
watch_2 = Watch(components.hours)
watch_3 = Watch(components.minutes)
watch_4 = Watch(components.seconds)
watch_5 = Watch(components.milliseconds)
