# Dynamo graph DSCore.TimeSpan.Subtract.dyn "Subtract" (Dynamo 2.0.1.5055)

code_block = CodeBlock { 10; }
create = TimeSpan.Create(days=code_block)
watch = Watch(create)
code_block_2 = CodeBlock { 5; }
create_2 = TimeSpan.Create(hours=code_block_2)
watch_2 = Watch(create_2)
subtract = TimeSpan.Subtract(timeSpan1=watch, timeSpan2=watch_2)
watch_3 = Watch(subtract)
