# Dynamo graph DSCore.TimeSpan.TotalSeconds.dyn "TotalSeconds" (Dynamo 2.0.1.5055)

code_block = CodeBlock { 2; }
code_block_2 = CodeBlock { 3; }
code_block_3 = CodeBlock { 30; }
create = TimeSpan.Create(days=code_block, hours=code_block_2, minutes=code_block_3)
watch = Watch(create)
totalSeconds = TimeSpan.TotalSeconds(timeSpan=watch)
watch_2 = Watch(totalSeconds)
