# Dynamo graph DSOffice.Data.ExportToExcel.dyn "Data.ExportToExcel" (Dynamo 2.13.1.3887)

file_path = Filename(".\Sample.xlsx")
string = StringInput("LettersAndNumbers")
code_block = CodeBlock { 0; }
code_block_2 = CodeBlock { "A".."D"; 0..3; }
list_create = List.Create(item0=code_block_2.out0, item1=code_block_2.out1)
exportToExcel = Data.ExportToExcel(filePath=file_path, sheetName=string, startRow=code_block, startColumn=code_block, data=list_create)
watch = Watch(exportToExcel)
