# Dynamo graph DSOffice.Data.ImportCSV.dyn "DSOffice.Data.ImportCSV_img" (Dynamo 2.17.0.3255)

file_path = Filename("..\..\..\..\..\..\..\..\..\..\Temp\sample.csv")
importCSV = Data.ImportCSV(filePath=file_path)
watch = Watch(importCSV)
