# Dynamo graph DSOffice.Data.ImportExcel.dyn "DSOffice.Data.ImportExcel_img" (Dynamo 2.17.0.3255)

file_path = Filename("..\..\..\..\..\..\..\..\..\..\Temp\sampleExcel.xlsx")
file_from_path = FileObject(path=file_path)
code_block = CodeBlock { "samplesheet"; }
importExcel = Data.ImportExcel(file=file_from_path, sheetName=code_block)
watch = Watch(importExcel)
