# Dynamo graph DSOffice.Data.OpenXMLImportExcel.dyn "Data.OpenXMLExportExcel" (Dynamo 2.13.1.3887)

file_path = Filename(".\DSOffice.Data.OpenXMLImportExcelSample.xlsx")
string = StringInput("LettersAndNumbers")
code_block = CodeBlock { "A".."D"; 0..3; }
list_create = List.Create(item0=code_block.out0, item1=code_block.out1)
openXMLExportExcel = Data.OpenXMLExportExcel(filePath=file_path, sheetName=string, data=list_create)
watch = Watch(openXMLExportExcel)
watch_2 = Watch(list_create)
