# Dynamo graph DWYJGQGBW2MD57NAYFKR3UEMPTHASLR2IV2X2SUK3OKI35GCEVHQ.dyn "Autodesk.DesignScript.Geometry.TSpline.TSplineSurface.ByPlaneOriginNormal" (Dynamo 2.19.3.6543)

code_block = CodeBlock { 5; }
byCoordinates = Point.ByCoordinates(y=code_block)
XAxis = Vector.XAxis()
code_block_2 = CodeBlock { 10; 20; }
byCoordinates_2 = Point.ByCoordinates(x=code_block_2.out0, y=code_block_2.out1)
code_block_3 = CodeBlock { 3; 4; }
boolean = BoolSelector(false)
byAxial = TSpline.TSplineInitialSymmetry.ByAxial(xAxis=boolean, yAxis=boolean, zAxis=boolean)
boolean_2 = BoolSelector(true)
byPlaneOriginNormal = TSpline.TSplineSurface.ByPlaneOriginNormal(origin=byCoordinates, normal=XAxis, maxCorner=byCoordinates_2, xSpans=code_block_3.out0, ySpans=code_block_3.out1, symmetry=byAxial, inSmoothMode=boolean_2)
