# Dynamo graph DesignScript.Builtin.Dictionary.Keys.dyn (Dynamo 2.17.0.3255)

code_block = CodeBlock { ["foo","bar"]; [1,2]; }
byKeysValues = DesignScript.Builtin.Dictionary.ByKeysValues(keys=code_block.out0, values=code_block.out1)
keys = DesignScript.Builtin.Dictionary.Keys(dictionary=byKeysValues)
