# Dynamo graph DesignScript.Builtin.Dictionary.Values.dyn (Dynamo 2.17.0.3255)

code_block = CodeBlock { ["foo","bar"]; [1,2]; }
byKeysValues = DesignScript.Builtin.Dictionary.ByKeysValues(keys=code_block.out0, values=code_block.out1)
values = DesignScript.Builtin.Dictionary.Values(dictionary=byKeysValues)
