# Dynamo graph DynamoUnits.Symbol.ByTypeID.dyn "Symbol.ByTypeID" (Dynamo 2.14.0.3835)

string = StringInput("autodesk.unit.symbol:footSingleQuote-1.0.1")
byTypeID = DynamoUnits.Symbol.ByTypeID(typeId=string)
watch = Watch(byTypeID)
