# Dynamo graph DynamoUnits.Symbol.StringifyDecimal.dyn "Symbol.StringifyDecimal" (Dynamo 2.13.1.3887)

number = DoubleInput(1.5)
number_2 = DoubleInput(1)
symbols = Symbols("Feet: '")
stringifyDecimal = DynamoUnits.Symbol.StringifyDecimal(value=number, precision=number_2, symbol=symbols)
watch = Watch(stringifyDecimal)
