# Dynamo graph DynamoUnits.Symbol.StringifyFraction.dyn "Symbol.StringifyFraction" (Dynamo 2.13.1.3887)

number = DoubleInput(1.5)
number_2 = DoubleInput(1)
symbols = Symbols("Feet: '")
stringifyFraction = DynamoUnits.Symbol.StringifyFraction(value=number, precision=number_2, symbol=symbols)
watch = Watch(stringifyFraction)
