# Dynamo graph DynamoUnits.Symbol.SymbolsByUnit.dyn "Symbol.SymbolsByUnit" (Dynamo 2.13.1.3887)

units = Units("Feet")
symbolsByUnit = DynamoUnits.Symbol.SymbolsByUnit(unit=units)
watch = Watch(symbolsByUnit)
