# Dynamo graph DynamoUnits.Unit.AreUnitsConvertible.dyn (Dynamo 2.19.0.5742)

units = Units("Kilometers")
units_2 = Units("Kilocalories")
areUnitsConvertible = DynamoUnits.Unit.AreUnitsConvertible(fromUnit=units, toUnit=units_2)
watch = Watch(areUnitsConvertible)
units_3 = Units("Kilometers")
units_4 = Units("Miles")
areUnitsConvertible_2 = DynamoUnits.Unit.AreUnitsConvertible(fromUnit=units_3, toUnit=units_4)
watch_2 = Watch(areUnitsConvertible_2)
