# Dynamo graph DynamoUnits.Unit.ConvertibleUnits.dyn "Unit.ConvertibleUnits" (Dynamo 2.14.0.3835)

units = Units("Feet")
convertibleUnits = DynamoUnits.Unit.ConvertibleUnits(unit=units)
watch = Watch(convertibleUnits)
