# Dynamo graph DynamoUnits.Utilities.ConvertByUnits.dyn (Dynamo 3.5.0.6812)

number = DoubleInput(5.5)
units = Units("Feet")
units_2 = Units("Meters")
convertByUnits = DynamoUnits.Utilities.ConvertByUnits(value=number, fromUnit=units, toUnit=units_2)
watch = Watch(convertByUnits)
