# Dynamo graph DynamoUnits.Utilities.ParseExpression.dyn "Utilities.ParseExpression" (Dynamo 2.13.1.3887)

string = StringInput("(1 / 5 + 6 - 7 )^2")
parseExpression = DynamoUnits.Utilities.ParseExpression(expression=string)
watch = Watch(parseExpression)
