# Dynamo graph E62L7SP5TZLSFZF6WG4XDSUMT7PBFAQVFDFOPSRAP7JMXBUTQM3Q.dyn "ByLengths" (Dynamo 2.0.1.5055)

code_block = CodeBlock { 2; }
randomList = Math.RandomList(amount=code_block)
code_block_2 = CodeBlock(x=randomList) { x*12; }
code_block_3 = CodeBlock { 0; 1; }
getItemAtIndex = List.GetItemAtIndex(list=code_block_2, index=code_block_3.out0)
getItemAtIndex_2 = List.GetItemAtIndex(list=code_block_2, index=code_block_3.out1)
byOrigin = CoordinateSystem.ByOrigin(x=getItemAtIndex, y=getItemAtIndex_2)
number_slider = DoubleSlider(7.3, range=0..20 step 0.1)  # graph input
number_slider_2 = DoubleSlider(11.8, range=0..20 step 0.1)  # graph input
number_slider_3 = DoubleSlider(5.7, range=0..20 step 0.1)  # graph input
byLengths = Cuboid.ByLengths(cs=byOrigin, width=number_slider, length=number_slider_2, height=number_slider_3)
