# Dynamo graph EXQDCVFI3OT5SKR7TAAZHHPRQTFTGPSESCN2SXOJLSORL2ATIOCA.dyn "Autodesk.DesignScript.Geometry.Curve.ExtrudeAsSolid" (Dynamo 2.19.0.5874)

number_slider = DoubleSlider(5, range=3..10 step 1)  # graph input
code_block = CodeBlock(a=number_slider) { 0..360..360/(a-1); }
randomList = Math.RandomList(amount=number_slider)
code_block_2 = CodeBlock(x=randomList) { x*5; }
byCylindricalCoordinates = Point.ByCylindricalCoordinates(angle=code_block, radius=code_block_2)
boolean = BoolSelector(true)  # graph input
byPoints = NurbsCurve.ByPoints(points=byCylindricalCoordinates, closeCurve=boolean)
code_block_3 = CodeBlock { 3; -2; 1; }
byCoordinates = Vector.ByCoordinates(x=code_block_3.out0, y=code_block_3.out1, z=code_block_3.out2)
number_slider_2 = DoubleSlider(2, range=-10..10 step 0.1)  # graph input
extrudeAsSolid = Curve.ExtrudeAsSolid(curve=byPoints, direction=byCoordinates, distance=number_slider_2)
