# Dynamo graph FPPU5FCLXHQEPRW7XPEABZGTPZWIO4HFADTOKNKVF4776WBW7AMQ.dyn "Autodesk.DesignScript.Geometry.CoordinateSystem.Scale" (Dynamo 2.19.0.5742)

number = DoubleInput(2)
byCoordinates = Point.ByCoordinates(x=number, y=number)
byOriginVectors = CoordinateSystem.ByOriginVectors(origin=byCoordinates)
number_2 = DoubleInput(2)
# note: Note: This will not scale the coordinate system "in place", but take into account the base coordinate system's axes.
scale = CoordinateSystem.Scale(coordinateSystem=byOriginVectors, xamount=number_2, yamount=number_2, zamount=number_2)
