# Dynamo graph G7Y5XS6FB4HO3WXDT5L7AR6OH54FV7RMJHVJMG2MHDHAMGF2ZVPQ.dyn "Autodesk.DesignScript.Geometry.Curve.TrimSegmentsByParameter(parameters)" (Dynamo 2.17.0.3255)

code_block = CodeBlock { 6; }
randomList = Math.RandomList(amount=code_block)
code_block_2 = CodeBlock(x=randomList) { x*10; }
randomList_2 = Math.RandomList(amount=code_block)
code_block_3 = CodeBlock(x=randomList_2) { x*10; }
byCoordinates = Point.ByCoordinates(x=code_block_2, y=code_block_3)
byControlPoints = NurbsCurve.ByControlPoints(points=byCoordinates)
code_block_4 = CodeBlock { 0..1..0.1; }
trimSegmentsByParameter = Curve.TrimSegmentsByParameter(curve=byControlPoints, parameters=code_block_4)
