# Dynamo graph GLVHD43IRWFTZKY7UVDJ7PNERQN5Z3PWTMFYVJ537HCGJCHCQQAQ.dyn "Autodesk.DesignScript.Geometry.TSpline.TSplineReflection.SegmentsCount" (Dynamo 2.19.3.6543)

code_block = CodeBlock { point1 = Point.ByCoordinates(10, 0, 0); 2; vector1 = Vector.ByCoordinates(0, 1, 0); }
byCenterPointRadiusNormal = Circle.ByCenterPointRadiusNormal(centerPoint=code_block.point1, radius=code_block.out1, normal=code_block.vector1)
code_block_2 = CodeBlock { 10; }
code_block_3 = CodeBlock { 0; 45; }
byCenterPointRadiusAngle = Arc.ByCenterPointRadiusAngle(radius=code_block_2, startAngle=code_block_3.out0, endAngle=code_block_3.out1)
boolean = BoolSelector(false)
code_block_4 = CodeBlock { 3; 10; }
boolean_2 = BoolSelector(true)
bySweep = TSpline.TSplineSurface.BySweep(profile=byCenterPointRadiusNormal, path=byCenterPointRadiusAngle, parallel=boolean, pathSpans=code_block_4.out0, profileSpans=code_block_4.out1, inSmoothMode=boolean_2)
XY = Plane.XY()
integer_slider = IntegerSlider(6, range=2..10 step 1)
integer_slider_2 = IntegerSlider(45, range=15..180 step 15)
byRadial = TSpline.TSplineReflection.ByRadial(plane=XY, segmentsCount=integer_slider, segmentAngle=integer_slider_2)
addReflections = TSpline.TSplineSurface.AddReflections(tSplineSurface=bySweep, reflections=byRadial)
code_block_5 = CodeBlock { 7; }
faceByIndex = TSpline.TSplineTopology.FaceByIndex(tSplineTopology=addReflections, index=code_block_5)
code_block_6 = CodeBlock { 2; }
byCoordinates = Vector.ByCoordinates(z=code_block_6)
extrudeFaces = TSpline.TSplineSurface.ExtrudeFaces(tSplineSurface=addReflections, faces=faceByIndex, direction=byCoordinates)
reflections = TSpline.TSplineSurface.Reflections(tSplineSurface=extrudeFaces)
segmentsCount = TSpline.TSplineReflection.SegmentsCount(tSplineReflection=reflections)
watch = Watch(segmentsCount)
