# Dynamo graph GLX34N2BPR4CQLUZBB4FTQ47NECC2T5CQ6KSRZQXSOY6HIHL5YGQ.dyn "Autodesk.DesignScript.Geometry.TSpline.TSplineSurface.BySphereFourPoints" (Dynamo 2.19.3.6543)

byCoordinates = Point.ByCoordinates()
code_block = CodeBlock { 2; }
byCoordinates_2 = Point.ByCoordinates(x=code_block, y=code_block)
code_block_2 = CodeBlock { 2; 4; }
byCoordinates_3 = Point.ByCoordinates(x=code_block_2.out0, z=code_block_2.out1)
code_block_3 = CodeBlock { 8; 2; }
byCoordinates_4 = Point.ByCoordinates(y=code_block_3.out0, z=code_block_3.out1)
list_create = List.Create(item0=byCoordinates, item1=byCoordinates_2, item2=byCoordinates_3, item3=byCoordinates_4)
code_block_4 = CodeBlock { 8; 5; }
boolean = BoolSelector(true)
boolean_2 = BoolSelector(true)
boolean_3 = BoolSelector(true)
byAxial = TSpline.TSplineInitialSymmetry.ByAxial(xAxis=boolean, yAxis=boolean_2, zAxis=boolean_3)
boolean_4 = BoolSelector(true)
bySphereFourPoints = TSpline.TSplineSurface.BySphereFourPoints(points=list_create, radiusSpans=code_block_4.out0, heightSpans=code_block_4.out1, symmetry=byAxial, inSmoothMode=boolean_4)
