# Dynamo graph GPVBCDN6ZVPTEE3IRF75ZGB7GIXLQYURCVYFV424TOUBVACZY44A.dyn "Autodesk.DesignScript.Geometry.TSpline.TSplineSurface.BridgeEdgesToFaces" (Dynamo 2.19.3.6543)

# group: Curve for the bridge to follow
code_block = CodeBlock { 7.5; -5; 0; }
byCoordinates = Point.ByCoordinates(x=code_block.out0, y=code_block.out2, z=code_block.out1)
code_block_2 = CodeBlock { 25; }
code_block_3 = CodeBlock(y=code_block_2) { y-y/2; }
code_block_4 = CodeBlock { 10; }
byCoordinates_2 = Point.ByCoordinates(x=code_block.out0, y=code_block_3, z=code_block_4)
byCoordinates_3 = Point.ByCoordinates(x=code_block.out0, y=code_block_2, z=code_block.out1)
join = List.Join(list0=byCoordinates, list1=byCoordinates_2, list2=byCoordinates_3)
byPoints = NurbsCurve.ByPoints(points=join)

code_block_5 = CodeBlock { [0,15]; }
byCoordinates_4 = Point.ByCoordinates(y=code_block_5)
YAxis = Vector.YAxis()
code_block_6 = CodeBlock { 15; }
byCoordinates_5 = Point.ByCoordinates(x=code_block_6, y=code_block_6)
code_block_7 = CodeBlock { 3; }
boolean = BoolSelector(true)
byPlaneOriginNormal = TSpline.TSplineSurface.ByPlaneOriginNormal(origin=byCoordinates_4, normal=YAxis, maxCorner=byCoordinates_5, xSpans=code_block_7, ySpans=code_block_7, inSmoothMode=boolean)
code_block_8 = CodeBlock(x=byPlaneOriginNormal) { x[0]; x[1]; }
code_block_9 = CodeBlock { 4; }
faceByIndex = TSpline.TSplineTopology.FaceByIndex(tSplineTopology=code_block_8.out1, index=code_block_9)
deleteFaces = TSpline.TSplineSurface.DeleteFaces(tSplineSurface=code_block_8.out1, faces=faceByIndex)
code_block_10 = CodeBlock { [4,7,16,19]; }
edgeByIndex = TSpline.TSplineTopology.EdgeByIndex(tSplineTopology=deleteFaces, index=code_block_10)
code_block_11 = CodeBlock { 4; }
faceByIndex_2 = TSpline.TSplineTopology.FaceByIndex(tSplineTopology=code_block_8.out0, index=code_block_11)
rotations = CodeBlock { 0; }
span_counts = CodeBlock { 8; }
boolean_2 = BoolSelector(false)
code_block_12 = CodeBlock { 5; }
vertexByIndex = TSpline.TSplineTopology.VertexByIndex(tSplineTopology=deleteFaces, index=code_block_12)
code_block_13 = CodeBlock { 6; }
vertexByIndex_2 = TSpline.TSplineTopology.VertexByIndex(tSplineTopology=code_block_8.out0, index=code_block_13)
boolean_3 = BoolSelector(false)
bridgeEdgesToFaces = TSpline.TSplineSurface.BridgeEdgesToFaces(tSplineSurface=deleteFaces, firstGroup=edgeByIndex, secondGroup=faceByIndex_2, frameRotations=rotations, spansCounts=span_counts, keepSubdCreases=boolean_2, firstAlignVertices=vertexByIndex, secondAlignVertices=vertexByIndex_2, flipAlignmentFlags=boolean_3)
