# Dynamo graph GV5KUSHDGL7YVBZAR4HEGY5NIXFIG3XTV6ZQPHC5MWWGEVOSRJ4Q.dyn "Curve mapper node" (Dynamo 3.6.0.6885)

# group: For evenly distributed numbers
# To map numbers in a given range with equal distribution, provide the "Count" (number) of values to map generate
limits = CodeBlock { 0; 20; }
count_of_values = DoubleSlider(80, range=10..100 step 1)
curve_mapper = CurveMapperNodeModel(x_MinLimit=limits.out0, x_MaxLimit=limits.out1, y_MinLimit=limits.out0, y_MaxLimit=limits.out1, values=count_of_values, LinearCurveControlPointData1={X: 0, Y: 240, Tag: ""}, LinearCurveControlPointData2={X: 240, Y: 0, Tag: ""}, BezierCurveControlPointData1={X: 0, Y: 240, Tag: ""}, BezierCurveControlPointData2={X: 240, Y: 240, Tag: ""}, BezierCurveControlPointData3={X: 48, Y: 48, Tag: ""}, BezierCurveControlPointData4={X: 192, Y: 48, Tag: ""}, SineWaveControlPointData1={X: 52.76755265, Y: 155.490688, Tag: ""}, SineWaveControlPointData2={X: 107.2303507, Y: 65.13519396, Tag: ""}, CosineWaveControlPointData1={X: 0, Y: 102.5831398, Tag: ""}, CosineWaveControlPointData2={X: 53.59822099, Y: 206.3798525, Tag: ""}, ParabolicCurveControlPointData1={X: 120, Y: 24, Tag: ""}, ParabolicCurveControlPointData2={X: 240, Y: 240, Tag: ""}, PerlinNoiseControlPointData1={X: 120, Y: 0, Tag: ""}, PerlinNoiseControlPointData2={X: 0, Y: 240, Tag: ""}, PerlinNoiseControlPointData3={X: 120, Y: 120, Tag: ""}, PowerCurveControlPointData1={X: 120, Y: 120, Tag: ""}, SquareRootCurveControlPointData1={X: 0, Y: 240, Tag: ""}, SquareRootCurveControlPointData2={X: 120, Y: 120, Tag: ""}, GaussianCurveControlPointData1={X: 0, Y: 192, Tag: ""}, GaussianCurveControlPointData2={X: 120, Y: 120, Tag: "GaussianCurveControlPointData2"}, GaussianCurveControlPointData3={X: 96, Y: 240, Tag: "GaussianCurveControlPointData3"}, GaussianCurveControlPointData4={X: 144, Y: 240, Tag: "GaussianCurveControlPointData4"}, MinLimitX=0, MaxLimitX=20, MinLimitY=0, MaxLimitY=20, PointsCount=[80], DynamicCanvasSize=240, SelectedGraphType="CosineWave")
height_z_coorrdinates = DoubleSlider(20, range=0..100 step 0.1)
code_block = CodeBlock(height=height_z_coorrdinates) { [0,height/2,height]; }
byCoordinates = Point.ByCoordinates(x=curve_mapper.x_Values@L2, y=curve_mapper.y_Values@L2, z=code_block@L1, lacing=Longest)
transpose = List.Transpose(lists=byCoordinates)
byPoints = PolyCurve.ByPoints(points=transpose)

# group: For Unevenly Distributed Numbers
# To map numbers that are not evenly distributed in the given range, provide the list of values as inputs
limits_2 = CodeBlock { 15; 25; }
list_of_values = CodeBlock { [0.75,1.2,1.6,1.9,2.0,2.1,2.5,3]; }
curve_mapper_2 = CurveMapperNodeModel(x_MinLimit=limits_2.out0, x_MaxLimit=limits_2.out1, y_MinLimit=limits_2.out0, y_MaxLimit=limits_2.out1, values=list_of_values, LinearCurveControlPointData1={X: 0, Y: 240, Tag: ""}, LinearCurveControlPointData2={X: 240, Y: 0, Tag: ""}, BezierCurveControlPointData1={X: 0, Y: 240, Tag: ""}, BezierCurveControlPointData2={X: 240, Y: 240, Tag: ""}, BezierCurveControlPointData3={X: 48, Y: 48, Tag: ""}, BezierCurveControlPointData4={X: 192, Y: 48, Tag: ""}, SineWaveControlPointData1={X: 2.046178026, Y: 87.41654223, Tag: ""}, SineWaveControlPointData2={X: 237.7178392, Y: 175.3850086, Tag: ""}, CosineWaveControlPointData1={X: 0, Y: 0, Tag: ""}, CosineWaveControlPointData2={X: 120, Y: 240, Tag: ""}, ParabolicCurveControlPointData1={X: 78.89653773, Y: 60.89839945, Tag: ""}, ParabolicCurveControlPointData2={X: 240, Y: 240, Tag: ""}, PerlinNoiseControlPointData1={X: 120, Y: 0, Tag: ""}, PerlinNoiseControlPointData2={X: 0, Y: 240, Tag: ""}, PerlinNoiseControlPointData3={X: 120, Y: 120, Tag: ""}, PowerCurveControlPointData1={X: 120, Y: 120, Tag: ""}, SquareRootCurveControlPointData1={X: 0, Y: 240, Tag: ""}, SquareRootCurveControlPointData2={X: 120, Y: 120, Tag: ""}, GaussianCurveControlPointData1={X: 0, Y: 181.7201574, Tag: ""}, GaussianCurveControlPointData2={X: 119.4533519, Y: 120, Tag: "GaussianCurveControlPointData2"}, GaussianCurveControlPointData3={X: 46.96078944, Y: 240, Tag: "GaussianCurveControlPointData3"}, GaussianCurveControlPointData4={X: 192.5134421, Y: 240, Tag: "GaussianCurveControlPointData4"}, MinLimitX=15, MaxLimitX=25, MinLimitY=15, MaxLimitY=25, PointsCount=[0.75, 1.2, 1.6, 1.9, 2, 2.1, 2.5, 3], DynamicCanvasSize=240, SelectedGraphType="GaussianCurve")
byCoordinates_2 = Point.ByCoordinates(x=curve_mapper_2.x_Values@L2, y=curve_mapper_2.y_Values@L2, lacing=Longest)
byPoints_2 = NurbsCurve.ByPoints(points=byCoordinates_2)
