# Dynamo graph GVO3NNSNHNAH3DJS5OR37DI2A457QGYX4BQGMHO4IGUUUHZV3HSQ.dyn "Autodesk.DesignScript.Geometry.TSpline.TSplineSurface.ByConePointRadius" (Dynamo 2.19.3.6543)

number_slider = DoubleSlider(-10, range=-10..100 step 0.1)
byCoordinates = Point.ByCoordinates(x=number_slider)
number_slider_2 = DoubleSlider(20, range=0..100 step 0.1)
byCoordinates_2 = Point.ByCoordinates(z=number_slider_2)
code_block = CodeBlock { 12; 4; 10; }
code_block_2 = CodeBlock { 8; 5; }
boolean = BoolSelector(false)
boolean_2 = BoolSelector(true)
boolean_3 = BoolSelector(false)
byAxial = TSpline.TSplineInitialSymmetry.ByAxial(xAxis=boolean, yAxis=boolean_2, zAxis=boolean_3)
boolean_4 = BoolSelector(true)
byConePointsRadius = TSpline.TSplineSurface.ByConePointsRadius(startPoint=byCoordinates, endPoint=byCoordinates_2, radius=code_block.out2, radiusSpans=code_block_2.out0, heightSpans=code_block_2.out1, symmetry=byAxial, inSmoothMode=boolean_4)
