# Dynamo graph GeometryUI.DeserializeFromSABWithUnits.dyn "Geometry.DeserializeFromSABWithUnits" (Dynamo 2.19.0.6156)

# group: Serialized binary stream data
# Collapsed as a group as this Code Block is wildly long...
code_block = CodeBlock()
# ---------- code_block.designscript (5854 lines) ----------
[
  [
    65,
    67,
    73,
    83,
    32,
    66,
    105,
    110,
    97,
    114,
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    97
  ]
];
# ----------------------------------------

units = Units("Millimeters")
# note: Original Cuboid geometry generated with 2 units of measurement (Unitless), using the 'dynamoUnit' input will scale to the chosen Unit for use in other software.
deserializeFromSABWithUnits = Geometry.DeserializeFromSABWithUnits(buffer=code_block, dynamoUnit=units)
