# Dynamo graph H7WNBOQXEC5RUVELW464ZP2E7CYHSPZ22TJHQJO4AKA4LHFB6N3A.dyn "Autodesk.DesignScript.Geometry.TSpline.TSplineSurface.ImportFromTSM(file, inSmoothMode)" (Dynamo 2.19.3.6543)

file_path = Filename("C:\Users\Daria\source\repos\Dynamo\bin\AnyCPU\Debug\en-US\fallback_docs\SKULL.tsm")
file_from_path = FileObject(path=file_path)
boolean = BoolSelector(true)
importFromTSM = TSpline.TSplineSurface.ImportFromTSM(file=file_from_path, inSmoothMode=boolean)
