# Dynamo graph HBD752E5KQ2LBVQYS575OP546LHHTXJCD4I2NUKGZV4QDHJLBMMQ.dyn "Autodesk.DesignScript.Geometry.TSpline.TSplineSurface.DeserializeFromTSM" (Dynamo 2.19.3.6543)

file_path = Filename("P:\Shared\Archilizer\Clients\Autodesk\Projects\23 - Q4\Nodes Documentation\TSplines\TSM TSS\EX_TSM.tsm")
boolean = BoolSelector(true)
importFromTSM = TSpline.TSplineSurface.ImportFromTSM(file=file_path, inSmoothMode=boolean)
serializeAsTSM = TSpline.TSplineSurface.SerializeAsTSM(tSplineSurface=importFromTSM)
watch = Watch(serializeAsTSM)
boolean_2 = BoolSelector(true)
deserializeFromTSM = TSpline.TSplineSurface.DeserializeFromTSM(content=serializeAsTSM, inSmoothMode=boolean_2)
watch_2 = Watch(importFromTSM)
