# Dynamo graph HEBF4GCPFFMBMYJFF6Z43YJXGHIM7MAZKEXMJR4UQ4BDSV22EUOA.dyn "Autodesk.DesignScript.Geometry.CoordinateSystem.Translate" (Dynamo 2.19.0.5742)

byOrigin = CoordinateSystem.ByOrigin()
x_position = DoubleSlider(3.8, range=0..5 step 0.1)  # graph input
y_position = DoubleSlider(2.7, range=0..5 step 0.1)  # graph input
byCoordinates = Vector.ByCoordinates(x=x_position, y=y_position)
translate = CoordinateSystem.Translate(coordinateSystem=byOrigin, direction=byCoordinates)
byRadiusHeight = Cylinder.ByRadiusHeight(coordinateSystem=translate)
color_palette = ColorPalette({R: 100, G: 141, B: 198, A: 175})
byGeometryColor = Modifiers.GeometryColor.ByGeometryColor(geometry=byRadiusHeight, color=color_palette)
