# Dynamo graph HJVNQTWA5OIN3IEMTVCDNHS4EDEZD7QGICLE5I7LFBSR5XR6NZXQ.dyn "ByCylindricalCoordinates" (Dynamo 2.0.1.5055)

code_block = CodeBlock { 2.8; }
code_block_2 = CodeBlock { 3.9; }
byRadiusHeight = Cylinder.ByRadiusHeight(radius=code_block, height=code_block_2)
code_block_3 = CodeBlock { 0..719..#40; 0.5..3.4..#40; }
byCylindricalCoordinates = CoordinateSystem.ByCylindricalCoordinates(radius=code_block, theta=code_block_3.out0, height=code_block_3.out1)
indent_depth = DoubleSlider(0.6, range=0..2 step 0.1)  # graph input
byCartesianCoordinates = Point.ByCartesianCoordinates(cs=byCylindricalCoordinates, z=indent_depth)
indent_radius = DoubleSlider(0.76, range=0.1..1 step 0.01)  # graph input
byCenterPointRadius = Sphere.ByCenterPointRadius(centerPoint=byCartesianCoordinates, radius=indent_radius)
differenceAll = Solid.DifferenceAll(solid=byRadiusHeight, others=byCenterPointRadius)
code_block_4 = CodeBlock(geometry=byCenterPointRadius) { color = Color.ByARGB(10,141,198,217); GeometryColor.ByGeometryColor(geometry, color); }
