# Dynamo graph HPPPUZ44WSFE77XKRGFZMFM4FVPCIAERWGT6OF6U3ECKGKVBF3FA.dyn "Autodesk.DesignScript.Geometry.TSpline.TSplineSurface.SerializeAsTSM" (Dynamo 2.19.3.6543)

file_path = Filename(".\donut.txt")
code_block = CodeBlock { 5; 10; 6; 4; }
code_block_2 = CodeBlock { 3; }
byRadial = TSpline.TSplineInitialSymmetry.ByRadial(symmetricFaces=code_block_2)
boolean = BoolSelector(true)
byTorusCenterRadii = TSpline.TSplineSurface.ByTorusCenterRadii(innerRadius=code_block.out0, outerRadius=code_block.out1, innerRadiusSpans=code_block.out2, outerRadiusSpans=code_block.out3, symmetry=byRadial, inSmoothMode=boolean)
code_block_3 = CodeBlock { 20; }
vertexByIndex = TSpline.TSplineTopology.VertexByIndex(tSplineTopology=byTorusCenterRadii, index=code_block_3)
code_block_4 = CodeBlock { 5; }
byCoordinates = Vector.ByCoordinates(z=code_block_4)
moveVertices = TSpline.TSplineSurface.MoveVertices(tSplineSurface=byTorusCenterRadii, vertices=vertexByIndex, vector=byCoordinates)
serializeAsTSM = TSpline.TSplineSurface.SerializeAsTSM(tSplineSurface=moveVertices)
writeText = FileSystem.WriteText(filePath=file_path, text=serializeAsTSM)
