# Dynamo graph JAQZIUEI4HVTL2VSANJDP5ZVTBVZCVAK3YM4PMUM7WIQ3TLZIKAQ.dyn "Autodesk.DesignScript.Geometry.Vector.Scale" (Dynamo 2.19.0.5742)

code_block = CodeBlock { 1; }
byCoordinates = Vector.ByCoordinates(x=code_block, y=code_block, z=code_block)
code_block_2 = CodeBlock { 2; }
scale = Vector.Scale(vector=byCoordinates, xScaleFactor=code_block_2)
length = Vector.Length(vector=scale)
watch = Watch(length)
length_2 = Vector.Length(vector=byCoordinates)
watch_2 = Watch(length_2)
scale_2 = Vector.Scale(vector=byCoordinates, yScaleFactor=code_block_2, zScaleFactor=code_block_2)
length_3 = Vector.Length(vector=scale_2)
watch_3 = Watch(length_3)
