# Dynamo graph JDRXXB3ZLF7RXZJRV66VKV5ZDAZGN5YCY7ZLVWABJQNDVHNU4QKA.dyn "Autodesk.DesignScript.Geometry.TSpline.TSplineSurface.ByPlaneOriginXAxisYAxis" (Dynamo 2.19.3.6543)

code_block = CodeBlock { 5; }
byCoordinates = Point.ByCoordinates(y=code_block)
code_block_2 = CodeBlock { 1; }
byCoordinates_2 = Vector.ByCoordinates(x=code_block_2, y=code_block_2)
ZAxis = Vector.ZAxis()
code_block_3 = CodeBlock { 10; 20; }
byCoordinates_3 = Point.ByCoordinates(x=code_block_3.out0, y=code_block_3.out1)
code_block_4 = CodeBlock { 3; 4; }
boolean = BoolSelector(false)
byAxial = TSpline.TSplineInitialSymmetry.ByAxial(xAxis=boolean, yAxis=boolean, zAxis=boolean)
boolean_2 = BoolSelector(true)
byPlaneOriginXAxisYAxis = TSpline.TSplineSurface.ByPlaneOriginXAxisYAxis(origin=byCoordinates, xAxis=byCoordinates_2, yAxis=ZAxis, maxCorner=byCoordinates_3, xSpans=code_block_4.out0, ySpans=code_block_4.out1, symmetry=byAxial, inSmoothMode=boolean_2)
