# Dynamo graph KB37RARA32V2WDFDQAYZ4ZFBA3AOPWGQNDOAMYU4G6VXI5W6TR3Q.dyn "Autodesk.DesignScript.Geometry.TSpline.TSplineInitialSymmetry.IsRadial" (Dynamo 2.19.3.6543)

number_slider = DoubleSlider(40, range=0..100 step 1)
byCoordinates = Point.ByCoordinates(z=number_slider)
code_block = CodeBlock { 20; }
code_block_2 = CodeBlock { 5; }
code_block_3 = CodeBlock { 10; }
code_block_4 = CodeBlock { 2; }
byRadial = TSpline.TSplineInitialSymmetry.ByRadial(symmetricFaces=code_block_4)
byConePointsRadii = TSpline.TSplineSurface.ByConePointsRadii(endPoint=byCoordinates, startRadius=code_block, radiusSpans=code_block_2, heightSpans=code_block_3, symmetry=byRadial)
isRadial = TSpline.TSplineInitialSymmetry.IsRadial(tSplineInitialSymmetry=byRadial)
watch = Watch(isRadial)
