# Dynamo graph KZOSID2TIPTCLLSXTJGULJ3Q6HYCYY3IWXWU2BW2J67G6R6CRBTA.dyn "CoreNodeModels.Input.BoolSelector" (Dynamo 3.3.0.5104)

boolean = BoolSelector(true)  # graph input
boolean_2 = BoolSelector(false)  # graph input
or_ = boolean || boolean_2
watch = Watch(or_)
boolean_3 = BoolSelector(true)  # graph input
boolean_4 = BoolSelector(true)  # graph input
or_2 = boolean_3 || boolean_4
watch_2 = Watch(or_2)
boolean_5 = BoolSelector(false)  # graph input
boolean_6 = BoolSelector(false)  # graph input
or_3 = boolean_5 || boolean_6
watch_3 = Watch(or_3)
