# Dynamo graph L2FVRQ5TN5PVLYNQW2GAMUC7ERMJJMQS7TSOYXVL75IED5KQPCPQ.dyn "ByLoft" (Dynamo 2.0.1.5055)

code_block = CodeBlock { 2; }
byWidthLength = Rectangle.ByWidthLength(width=code_block)
code_block_2 = CodeBlock { -2; }
number_slider = DoubleSlider(4, range=0..10 step 1)  # graph input
translate = Geometry.Translate(geometry=byWidthLength, xTranslation=code_block_2, zTranslation=number_slider)
create = List.Create(item0=byWidthLength, item1=translate)
code_block_3 = CodeBlock(z=number_slider) { 0..180..180/z; }
cos = Math.Cos(angle=code_block_3)
code_block_4 = CodeBlock(x=cos) { x-2; }
code_block_5 = CodeBlock(z=number_slider) { 0..z..1; }
byCoordinates = Point.ByCoordinates(x=code_block_4, z=code_block_5)
byPoints = NurbsCurve.ByPoints(points=byCoordinates)
code_block_6 = CodeBlock { 1; 0.5; }
byCoordinates_2 = Point.ByCoordinates(x=code_block_6.out0, y=code_block_6.out1)
code_block_7 = CodeBlock { -1; }
byCoordinates_3 = Point.ByCoordinates(x=code_block_7, y=code_block_6.out1, z=number_slider)
byStartPointEndPoint = Line.ByStartPointEndPoint(startPoint=byCoordinates_2, endPoint=byCoordinates_3)
create_2 = List.Create(item0=byPoints, item1=byStartPointEndPoint)
byLoft = Solid.ByLoft(crossSections=create, guideCurves=create_2)
