# Dynamo graph LMVGRWYVOONMRPCSD3NCYVD776V33DFYWXC2F5S3KREHPOX5A2FA.dyn (Dynamo 3.5.0.6812)

number_slider = DoubleSlider(3, range=0..100 step 0.1)
byOrigin = CoordinateSystem.ByOrigin(z=number_slider)
number_slider_2 = DoubleSlider(10, range=1..10 step 0.1)  # graph input
number_slider_3 = DoubleSlider(15, range=1..15 step 0.1)  # graph input
byWidthLength = Rectangle.ByWidthLength(coordinateSystem=byOrigin, width=number_slider_2, length=number_slider_3)
watch = Watch(byWidthLength)
watch_3d = Watch3D(byWidthLength)
