# Dynamo graph List.GroupByFunction.dyn (Dynamo 2.19.0.5742)

code_block = CodeBlock { 0..9..#10; }
number = DoubleInput(3)  # graph input
chop = List.Chop(list=code_block, lengths=number)
getItemAtIndex = List.GetItemAtIndex()  # unwired: list, index
groupByFunction = List.GroupByFunction(list=chop, groupFunction=getItemAtIndex)
watch = Watch(groupByFunction)
watch_2 = Watch(chop)
watch_3 = Watch(code_block)
getItemAtIndex_2 = List.GetItemAtIndex()  # unwired: list, index
groupByFunction_2 = List.GroupByFunction(list=watch_3, groupFunction=getItemAtIndex_2)
watch_4 = Watch(groupByFunction_2)
