# Dynamo graph List.RemoveIfNot.dyn (Dynamo 2.19.0.5742)

code_block = CodeBlock { p1 = Point.ByCoordinates(0,0,1); p2 = Point.ByCoordinates(2,4,3); l1 = Line.ByStartPointEndPoint(p1,p2); [p1,p2,l1]; }
watch = Watch(code_block.out3)
code_block_2 = CodeBlock { "Line"; }
removeIfNot = List.RemoveIfNot(list=watch, type=code_block_2)
watch_2 = Watch(removeIfNot)
