# Dynamo graph LoopWhile.dyn (Dynamo 2.19.0.5742)

code_block = CodeBlock { 0; }
code_block_2 = CodeBlock { 1; }
code_block_3 = CodeBlock { 100; }
lt = _ < code_block_3  # unwired: x
code_block_4 = CodeBlock { 10; }
add = _ + code_block_4  # unwired: x
loopWhile = LoopWhile(initialValue=code_block_2, continueWhile=lt, loopBody=add)
watch = Watch(loopWhile)
byCoordinates = Point.ByCoordinates(x=code_block, y=watch)
