# Dynamo graph MNNWHJCYE2KIJHONO2J56LQNPLRQZZARI7KF2BP4OJ6BRWGDXPAQ.dyn "ByWidthLength" (Dynamo 2.0.1.5055)

YZ = Plane.YZ()
number_slider = DoubleSlider(6.8, range=0..100 step 0.1)  # graph input
number_slider_2 = DoubleSlider(2.7, range=0..100 step 0.1)  # graph input
byWidthLength = Rectangle.ByWidthLength(plane=YZ, width=number_slider, length=number_slider_2)
