# Dynamo graph MQJ667AXSQFCK2Z2B7G2MNL35OIFJYLSADFLGXFJUJCA27FCHVHQ.dyn "Autodesk.DesignScript.Geometry.TSpline.TSplineSurface.BridgeFacesToFaces" (Dynamo 2.19.3.6543)

code_block = CodeBlock { 25; 5; }
boolean = BoolSelector(true)
byTorusCenterRadii = TSpline.TSplineSurface.ByTorusCenterRadii(innerRadius=code_block.out1, outerRadius=code_block.out0, innerRadiusSpans=code_block.out1, inSmoothMode=boolean)
code_block_2 = CodeBlock { 34; 42; }
faceByIndex = TSpline.TSplineTopology.FaceByIndex(tSplineTopology=byTorusCenterRadii, index=code_block_2.out0)
faceByIndex_2 = TSpline.TSplineTopology.FaceByIndex(tSplineTopology=byTorusCenterRadii, index=code_block_2.out1)
rotations = CodeBlock { 0; }
spans = CodeBlock { 15; }
code_block_3 = CodeBlock { 34; 42; }
vertexByIndex = TSpline.TSplineTopology.VertexByIndex(tSplineTopology=byTorusCenterRadii, index=code_block_3.out0)
vertexByIndex_2 = TSpline.TSplineTopology.VertexByIndex(tSplineTopology=byTorusCenterRadii, index=code_block_3.out1)
bridgeFacesToFaces = TSpline.TSplineSurface.BridgeFacesToFaces(tSplineSurface=byTorusCenterRadii, firstGroup=faceByIndex, secondGroup=faceByIndex_2, frameRotations=rotations, spansCounts=spans, firstAlignVertices=vertexByIndex, secondAlignVertices=vertexByIndex_2)
