# Dynamo graph Modifiers.GeometryColor.ByGeometryColor.dyn "Modifiers.GeometryColor.ByGeometryColor_img" (Dynamo 2.17.0.3255)

code_block = CodeBlock { 4; }
byCenterPointRadius = Circle.ByCenterPointRadius(radius=code_block)
byPatch = Surface.ByPatch(closedCurve=byCenterPointRadius)
code_block_2 = CodeBlock { 200; 252; 41; 217; }
byARGB = Color.ByARGB(alpha=code_block_2.out0, red=code_block_2.out1, green=code_block_2.out2, blue=code_block_2.out3)
byGeometryColor = Modifiers.GeometryColor.ByGeometryColor(geometry=byPatch, color=byARGB)
