# Dynamo graph N44VZ3AJYWSL6V3DZOJYGO3ER47KV2Q6UNXWX7N6U47NDLFO3TBQ.dyn "Autodesk.DesignScript.Geometry.TSpline.TSplineVertex.FunctionalValence" (Dynamo 2.19.3.6543)

code_block = CodeBlock { 30; }
byCoordinates = Point.ByCoordinates(x=code_block, y=code_block)
code_block_2 = CodeBlock { 4; }
boolean = BoolSelector(false)
byPlaneOriginNormal = TSpline.TSplineSurface.ByPlaneOriginNormal(maxCorner=byCoordinates, xSpans=code_block_2, ySpans=code_block_2, inSmoothMode=boolean)
code_block_3 = CodeBlock { 3; }
faceByIndex = TSpline.TSplineTopology.FaceByIndex(tSplineTopology=byPlaneOriginNormal, index=code_block_3)
subdivideFaces = TSpline.TSplineSurface.SubdivideFaces(tSplineSurface=byPlaneOriginNormal, faces=faceByIndex)
TPointVertices = TSpline.TSplineTopology.TPointVertices(tSplineTopology=subdivideFaces)
valence = TSpline.TSplineVertex.Valence(tSplineVertex=TPointVertices)
watch = Watch(valence)
UVNFrame = TSpline.TSplineVertex.UVNFrame(tSplineVertex=TPointVertices)
position = TSpline.TSplineUVNFrame.Position(tSplineUVNFrame=UVNFrame)
functionalValence = TSpline.TSplineVertex.FunctionalValence(tSplineVertex=TPointVertices)
watch_2 = Watch(functionalValence)
