# Dynamo graph NN2ZH7ONXE6AF3LL2XG7BSXNABGZRF4KYTGXDYF24O5PLZ2GWW4Q.dyn "Autodesk.DesignScript.Geometry.TSpline.TSplineSurface.EnableSmoothMode" (Dynamo 2.19.3.6543)

code_block = CodeBlock { 15; }
code_block_2 = CodeBlock { 3; 2; }
boolean = BoolSelector(false)
byBoxLengths = TSpline.TSplineSurface.ByBoxLengths(width=code_block, length=code_block, height=code_block, xSpans=code_block_2.out0, ySpans=code_block_2.out1, zSpans=code_block_2.out1, inSmoothMode=boolean)
code_block_3 = CodeBlock { [6,25,41]; }
edgeByIndex = TSpline.TSplineTopology.EdgeByIndex(tSplineTopology=byBoxLengths, index=code_block_3)
percentage = DoubleSlider(0.55, range=0.05..0.95 step 0.05)
number_of_segments = IntegerSlider(2, range=1..10 step 1)
boolean_2 = BoolSelector(false)
roundness = DoubleSlider(0.75, range=0.05..0.95 step 0.05)
bevelEdges = TSpline.TSplineSurface.BevelEdges(tSplineSurface=byBoxLengths, edges=edgeByIndex, percentage=percentage, segments=number_of_segments, keepOnFace=boolean_2, roundness=roundness)
enableSmoothMode = TSpline.TSplineSurface.EnableSmoothMode(tSplineSurface=bevelEdges)
code_block_4 = CodeBlock { 25; }
translate = Geometry.Translate(geometry=enableSmoothMode, xTranslation=code_block_4)
