# Dynamo graph NTIOVTTOXGWZ33W6ET5JH4PSYC7L3IFSWCJV4Y3IG3CTARQGOG3A.dyn "Autodesk.DesignScript.Geometry.TSpline.TSplineSurface.BridgeEdgesToEdges(alternative)1" (Dynamo 2.19.3.6543)

code_block = CodeBlock { [0,15]; }
byCoordinates = Point.ByCoordinates(y=code_block)
YAxis = Vector.YAxis()
code_block_2 = CodeBlock { 15; }
byCoordinates_2 = Point.ByCoordinates(x=code_block_2, y=code_block_2)
code_block_3 = CodeBlock { 3; }
boolean = BoolSelector(true)
byPlaneOriginNormal = TSpline.TSplineSurface.ByPlaneOriginNormal(origin=byCoordinates, normal=YAxis, maxCorner=byCoordinates_2, xSpans=code_block_3, ySpans=code_block_3, inSmoothMode=boolean)
code_block_4 = CodeBlock { 4; }
faceByIndex = TSpline.TSplineTopology.FaceByIndex(tSplineTopology=byPlaneOriginNormal, index=code_block_4)
deleteFaces = TSpline.TSplineSurface.DeleteFaces(tSplineSurface=byPlaneOriginNormal, faces=faceByIndex)
code_block_5 = CodeBlock(x=deleteFaces) { x[0]; x[1]; }
code_block_6 = CodeBlock { [4,7,16,19]; }
edgeByIndex = TSpline.TSplineTopology.EdgeByIndex(tSplineTopology=code_block_5.out0, index=code_block_6)
edgeByIndex_2 = TSpline.TSplineTopology.EdgeByIndex(tSplineTopology=code_block_5.out1, index=code_block_6)

# group: Curve for the bridge to follow
code_block_7 = CodeBlock { 7.5; -5; 0; }
byCoordinates_3 = Point.ByCoordinates(x=code_block_7.out0, y=code_block_7.out2, z=code_block_7.out1)
code_block_8 = CodeBlock { 25; }
code_block_9 = CodeBlock(y=code_block_8) { y-y/2; }
code_block_10 = CodeBlock { 10; }
byCoordinates_4 = Point.ByCoordinates(x=code_block_7.out0, y=code_block_9, z=code_block_10)
byCoordinates_5 = Point.ByCoordinates(x=code_block_7.out0, y=code_block_8, z=code_block_7.out1)
join = List.Join(list0=byCoordinates_3, list1=byCoordinates_4, list2=byCoordinates_5)
byPoints = NurbsCurve.ByPoints(points=join)

rotations = CodeBlock { 0; }
span_counts = CodeBlock { 8; }
boolean_2 = BoolSelector(false)
code_block_11 = CodeBlock { 5; }
vertexByIndex = TSpline.TSplineTopology.VertexByIndex(tSplineTopology=code_block_5.out0, index=code_block_11)
code_block_12 = CodeBlock { 6; }
vertexByIndex_2 = TSpline.TSplineTopology.VertexByIndex(tSplineTopology=code_block_5.out1, index=code_block_12)
boolean_3 = BoolSelector(false)
bridgeEdgesToEdges = TSpline.TSplineSurface.BridgeEdgesToEdges(tSplineSurface=code_block_5.out0, firstGroup=edgeByIndex, secondGroup=edgeByIndex_2, followCurves=byPoints, frameRotations=rotations, spansCounts=span_counts, keepSubdCreases=boolean_2, firstAlignVertices=vertexByIndex, secondAlignVertices=vertexByIndex_2, flipAlignmentFlags=boolean_3)
