# Dynamo graph NVXHF2HNH7CSSHULY6RSEYZOUROO42KV2T34SGQYWK4T7S3I3OYQ.dyn "Autodesk.DesignScript.Geometry.TSpline.TSplineSurface.ByQuadballCoordinateSystemRadius" (Dynamo 2.19.3.6543)

code_block = CodeBlock { 5; }
byCoordinates = Point.ByCoordinates(x=code_block, y=code_block)
byOrigin = CoordinateSystem.ByOrigin(origin=byCoordinates)
code_block_2 = CodeBlock { 4; 3; }
boolean = BoolSelector(true)
boolean_2 = BoolSelector(true)
boolean_3 = BoolSelector(true)
byAxial = TSpline.TSplineInitialSymmetry.ByAxial(xAxis=boolean, yAxis=boolean_2, zAxis=boolean_3)
boolean_4 = BoolSelector(true)
byQuadballCoordinateSystemRadius = TSpline.TSplineSurface.ByQuadballCoordinateSystemRadius(cs=byOrigin, radius=code_block_2.out0, spans=code_block_2.out1, symmetry=byAxial, inSmoothMode=boolean_4)
