# Dynamo graph Not.dyn (Dynamo 2.19.0.5742)

boolean = BoolSelector(false)  # graph input
code_block = CodeBlock(input=boolean) { !input; }
watch = Watch(code_block)
not_ = Not(x=boolean)
watch_2 = Watch(not_)
boolean_2 = BoolSelector(true)  # graph input
not_2 = Not(x=boolean_2)
watch_3 = Watch(not_2)
code_block_2 = CodeBlock(input=boolean_2) { !input; }
watch_4 = Watch(code_block_2)
