# Dynamo graph O4AZYQKKSK7J5LQTW2WAZMMEFQCRSMDS5RYJ7LGVKPDRQOPRHILQ.dyn "Autodesk.DesignScript.Geometry.TSpline.TSplineSurface.ByConeCoordinateSystemHeightRadii" (Dynamo 2.19.3.6543)

code_block = CodeBlock { 1; }
byCoordinates = Vector.ByCoordinates(x=code_block, z=code_block)
byOriginVectors = CoordinateSystem.ByOriginVectors(xAxis=byCoordinates)
code_block_2 = CodeBlock { 12; 4; 10; }
code_block_3 = CodeBlock { 8; 5; }
boolean = BoolSelector(false)
boolean_2 = BoolSelector(true)
boolean_3 = BoolSelector(false)
byAxial = TSpline.TSplineInitialSymmetry.ByAxial(xAxis=boolean, yAxis=boolean_2, zAxis=boolean_3)
boolean_4 = BoolSelector(true)
byConeCoordinateSystemHeightRadii = TSpline.TSplineSurface.ByConeCoordinateSystemHeightRadii(cs=byOriginVectors, height=code_block_2.out0, startRadius=code_block_2.out1, endRadius=code_block_2.out2, radiusSpans=code_block_3.out0, heightSpans=code_block_3.out1, symmetry=byAxial, inSmoothMode=boolean_4)
