# Dynamo graph OUBDJTXQVGIEZZTOCO3QDFCDT73JUQD54U6YYFBJZUKZDZEYPYKA.dyn "Autodesk.DesignScript.Geometry.TSpline.TSplineTopology.VerticesCount" (Dynamo 2.19.3.6543)

code_block = CodeBlock { -4; 4; }
byCoordinates = Point.ByCoordinates(x=code_block.out0, y=code_block.out0, z=code_block.out1)
code_block_2 = CodeBlock { 4; 3; }
boolean = BoolSelector(true)
byQuadballCenterRadius = TSpline.TSplineSurface.ByQuadballCenterRadius(center=byCoordinates, radius=code_block_2.out0, spans=code_block_2.out1, inSmoothMode=boolean)
verticesCount = TSpline.TSplineTopology.VerticesCount(tSplineTopology=byQuadballCenterRadius)
watch = Watch(verticesCount)
