# Dynamo graph PEZAIOOYHWK3SBHRTJTFKB4CTMRQFK7MX4N6YFCSNPDG5ICCLYBQ.dyn "Autodesk.DesignScript.Geometry.Curve.NormalAtParameter" (Dynamo 2.19.0.5874)

code_block = CodeBlock { 1; 2; 3; }
byCoordinates = Point.ByCoordinates(x=code_block.out0)
byCoordinates_2 = Point.ByCoordinates(y=code_block.out1)
byCoordinates_3 = Point.ByCoordinates(x=code_block.out2)
byThreePoints = Arc.ByThreePoints(firstPoint=byCoordinates, secondPoint=byCoordinates_2, thirdPoint=byCoordinates_3)
# note: Normal location on curve; 0 is the start point, 1 is the endpoint of the curve
normal_location = DoubleSlider(0.6, range=0..1 step 0.1)
normalAtParameter = Curve.NormalAtParameter(curve=byThreePoints, param=normal_location)

# group: Normal visualization
pointAtParameter = Curve.PointAtParameter(curve=byThreePoints, param=normal_location)
code_block_2 = CodeBlock { 5; }
byStartPointDirectionLength = Line.ByStartPointDirectionLength(startPoint=pointAtParameter, direction=normalAtParameter, length=code_block_2)
