# Dynamo graph QVBZTZWGLGK2PKP6QSZJI7UBI2Y5Z7HF4ZG7JKETOZCBLOF5IIPA.dyn "Autodesk.DesignScript.Geometry.TSpline.TSplineSurface.DuplicateFaces" (Dynamo 2.13.1.3887)

code_block = CodeBlock()
# ---------- code_block.designscript (6 lines) ----------
point1 = Point.ByCoordinates(0, 0, 0);
point2 = Point.ByCoordinates(2, 0, 0);
point3 = Point.ByCoordinates(3, 0, 2);
point4 = Point.ByCoordinates(3, 0, 5);
point5 = Point.ByCoordinates(1, 0, 7);
point6 = Point.ByCoordinates(1, 0, 9);
# ----------------------------------------
list_create = List.Create(item0=code_block.point1, item1=code_block.point2, item2=code_block.point3, item3=code_block.point4, item4=code_block.point5, item5=code_block.point6)
code_block_2 = CodeBlock { 3; }
boolean = BoolSelector(false)
byControlPoints = NurbsCurve.ByControlPoints(points=list_create, degree=code_block_2, closeCurve=boolean)
code_block_3 = CodeBlock { 360; }
code_block_4 = CodeBlock { 8; }
boolean_2 = BoolSelector(true)
boolean_3 = BoolSelector(true)
byRevolve = TSpline.TSplineSurface.ByRevolve(profile=byControlPoints, sweepAngle=code_block_3, radialSpans=code_block_4, axialSpans=code_block_4, uniform=boolean_2, inSmoothMode=boolean_3)
code_block_5 = CodeBlock { 0; 63; }
number_slider = DoubleSlider(4, range=1..20 step 1)
range = Range(start=code_block_5.out0, end=code_block_5.out1, step=number_slider)
faceByIndex = TSpline.TSplineTopology.FaceByIndex(tSplineTopology=byRevolve, index=range)
duplicateFaces = TSpline.TSplineSurface.DuplicateFaces(tSplineSurface=byRevolve, faces=faceByIndex)
XAxis = Vector.XAxis()
code_block_6 = CodeBlock { 8; }
translate = Geometry.Translate(geometry=duplicateFaces, direction=XAxis, distance=code_block_6)
watch_3d = Watch3D(translate)
