# Dynamo graph R56RKDC3YJDKDO3WMJD2V4SIMHIJCNVQ6PZV7SMATQASDKE7WEMA.dyn "ByPoints" (Dynamo 2.0.1.5055)

code_block = CodeBlock { 3; }
randomList = Math.RandomList(amount=code_block)
sort = List.Sort(list=randomList)
randomList_2 = Math.RandomList(amount=code_block)
sort_2 = List.Sort(list=randomList_2)
byCoordinates = Point.ByCoordinates(x=sort, y=sort_2)
boolean = BoolSelector(true)  # graph input
byPoints = NurbsCurve.ByPoints(points=byCoordinates, closeCurve=boolean)
