# Dynamo graph SEK72377I2YNUG2LJNOJ6APT3WYI3HJW6FDSVZL3LX2XEMYIA4OQ.dyn "Autodesk.DesignScript.Geometry.TSpline.TSplineSurface.ImportFromTSM(filePath, inSmoothMode)" (Dynamo 2.19.3.6543)

file_path = Filename("C:\Users\Daria\source\repos\Dynamo\bin\AnyCPU\Debug\en-US\fallback_docs\SKULL.tsm")
boolean = BoolSelector(true)
importFromTSM = TSpline.TSplineSurface.ImportFromTSM(filePath=file_path, inSmoothMode=boolean)
