# Dynamo graph SKQA27MR3KPQ6BWD6IMMJHE3TAZDI2MWFMURGZNYLU6BNNVX7FPQ.dyn "CoreNodeModels.Input.DoubleSlider" (Dynamo 3.3.0.5104)

number_slider = DoubleSlider(54, range=0..100 step 1)  # graph input
number_slider_2 = DoubleSlider(5, range=0..10 step 1)  # graph input
ge = number_slider >= number_slider_2
watch = Watch(ge)
