# Dynamo graph TTAJ2WGGNFLM755ADOCD3G7N4MJBQI66CAC7SXM3XCYLEIPLBOCQ.dyn "Autodesk.DesignScript.Geometry.TSpline.TSplineSurface.ByTorusCoordinateSystemRadii" (Dynamo 2.19.3.6543)

code_block = CodeBlock { 1; }
byCoordinates = Vector.ByCoordinates(x=code_block, z=code_block)
byOriginVectors = CoordinateSystem.ByOriginVectors(xAxis=byCoordinates)
code_block_2 = CodeBlock { 2; 4; }
code_block_3 = CodeBlock { 4; 5; }
code_block_4 = CodeBlock { 1; }
byRadial = TSpline.TSplineInitialSymmetry.ByRadial(symmetricFaces=code_block_4)
boolean = BoolSelector(true)
byTorusCoordinateSystemRadii = TSpline.TSplineSurface.ByTorusCoordinateSystemRadii(cs=byOriginVectors, innerRadius=code_block_2.out0, outerRadius=code_block_2.out1, innerRadiusSpans=code_block_3.out0, outerRadiusSpans=code_block_3.out1, symmetry=byRadial, inSmoothMode=boolean)
