# Dynamo graph Tessellation.Voronoi.ByParametersOnSurface.dyn "Tessellation.Voronoi.ByParametersOnSurface_img" (Dynamo 2.17.0.3255)

code_block = CodeBlock { 50; }
randomList = Math.RandomList(amount=code_block)
randomList_2 = Math.RandomList(amount=code_block)
byCoordinates = UV.ByCoordinates(u=randomList, v=randomList_2)
code_block_2 = CodeBlock { 10; }
byWidthLength = Rectangle.ByWidthLength(width=code_block_2, length=code_block_2)
byPatch = Surface.ByPatch(closedCurve=byWidthLength)
byParametersOnSurface = Tessellation.Voronoi.ByParametersOnSurface(uvs=byCoordinates, face=byPatch)
intersect = Geometry.Intersect(geometry=byParametersOnSurface, other=byPatch)
