# Dynamo graph U3C6XW5LVP2GS44OR67HZ43LHZHFNTYHMHG6X7YOGZMPS52CMXAA.dyn (Dynamo 1.1.0.2093)

code_block = CodeBlock { -3; 0; }
byOrigin = CoordinateSystem.ByOrigin(x=code_block.out0, y=code_block.out1)
byRadiusHeight = Cylinder.ByRadiusHeight(byOrigin)
x_position = DoubleSlider(1.6, range=0..5 step 0.1)
y_position = DoubleSlider(1.5, range=0..5 step 0.1)
byOrigin_2 = CoordinateSystem.ByOrigin(x=x_position, y=y_position)
z_rotation = DoubleSlider(32.1, range=0..100 step 0.1)
y_rotation = DoubleSlider(-39.9, range=-100..100 step 0.1)
bySphericalCoordinates = CoordinateSystem.BySphericalCoordinates(arg2=z_rotation, arg3=y_rotation)
transform = CoordinateSystem.Transform(byOrigin, byOrigin_2, bySphericalCoordinates)
byRadiusHeight_2 = Cylinder.ByRadiusHeight(transform)
