# Dynamo graph UYY33O65ZLXAIX5KFQN2EYDM2O5XLAGJFC4EWEKGUHZDIXLTI5BA.dyn "BySphericalCoordinates" (Dynamo 2.0.1.5055)

code_block = CodeBlock { 4; }
number_slider = DoubleSlider(172.1, range=0..359 step 0.1)  # graph input
number_slider_2 = DoubleSlider(240.1, range=0..359 step 0.1)  # graph input
code_block_2 = CodeBlock(theta=number_slider, phi=number_slider_2) { 0..theta..#20; 0..phi..#20; }
bySphericalCoordinates = CoordinateSystem.BySphericalCoordinates(radius=code_block, theta=code_block_2.out0, phi=code_block_2.out1)
byCartesianCoordinates = Point.ByCartesianCoordinates(cs=bySphericalCoordinates)
ZAxis = CoordinateSystem.ZAxis(coordinateSystem=bySphericalCoordinates)
number_slider_3 = DoubleSlider(1.4, range=0.1..5 step 0.1)  # graph input
byStartPointDirectionLength = Line.ByStartPointDirectionLength(startPoint=byCartesianCoordinates, direction=ZAxis, length=number_slider_3)
byLoft = Surface.ByLoft(crossSections=byStartPointDirectionLength)
byCenterPointRadius = Sphere.ByCenterPointRadius(radius=code_block)
code_block_3 = CodeBlock(geometry=byCenterPointRadius) { color = Color.ByARGB(200,141,198,217); GeometryColor.ByGeometryColor(geometry, color); }
