# Dynamo graph UZA22A4OYIXSIP3U5CUGNZ3WBDHIEMOS2MYI5GKTJJJFBTGI5JTA.dyn "Autodesk.DesignScript.Geometry.TSpline.TSplineSurface.WeldCoincidentVertices" (Dynamo 2.19.3.6543)

code_block = CodeBlock()
# ---------- code_block.designscript (3 lines) ----------
point1 = Point.ByCoordinates(10, 0, 0);
vector1 = Vector.ByCoordinates(0, 1, 0);
arc1 = Arc.ByCenterPointRadiusAngle(point1, 4, 120, 360, vector1);
# ----------------------------------------
code_block_2 = CodeBlock()
# ---------- code_block_2.designscript (2 lines) ----------
point1 = Point.ByCoordinates(-2, -6, 0);
arc1 = Arc.ByCenterPointRadiusAngle(point1, 10, 0, 45, Vector.ByCoordinates(0, 0, 1));
# ----------------------------------------
boolean = BoolSelector(false)
code_block_3 = CodeBlock { 3; 3; }
boolean_2 = BoolSelector(true)
bySweep = TSpline.TSplineSurface.BySweep(profile=code_block.arc1, path=code_block_2.arc1, parallel=boolean, pathSpans=code_block_3.out0, profileSpans=code_block_3.out1, inSmoothMode=boolean_2)
XZ = Plane.XZ()
mirror = Geometry.Mirror(geometry=bySweep, mirrorPlane=XZ)
join = List.Join(list0=bySweep, list1=mirror)
byCombinedTSplineSurfaces = TSpline.TSplineSurface.ByCombinedTSplineSurfaces(tSplineSurfaces=join)
code_block_4 = CodeBlock { 0.1; }

# group: Weld Coincident Vertices
weldCoincidentVertices = TSpline.TSplineSurface.WeldCoincidentVertices(tSplineSurface=byCombinedTSplineSurfaces, tolerance=code_block_4)

# group: Move vertex after welding
code_block_5 = CodeBlock { 8; }
vertexByIndex = TSpline.TSplineTopology.VertexByIndex(tSplineTopology=weldCoincidentVertices, index=code_block_5)
code_block_6 = CodeBlock { 5; }
byCoordinates = Vector.ByCoordinates(z=code_block_6)
moveVertices = TSpline.TSplineSurface.MoveVertices(tSplineSurface=weldCoincidentVertices, vertices=vertexByIndex, vector=byCoordinates)

code_block_7 = CodeBlock { 20; }
translate = Geometry.Translate(geometry=moveVertices, yTranslation=code_block_7)

# group: Move vertex before welding
code_block_8 = CodeBlock { 8; }
vertexByIndex_2 = TSpline.TSplineTopology.VertexByIndex(tSplineTopology=byCombinedTSplineSurfaces, index=code_block_8)
code_block_9 = CodeBlock { 5; }
byCoordinates_2 = Vector.ByCoordinates(z=code_block_9)
moveVertices_2 = TSpline.TSplineSurface.MoveVertices(tSplineSurface=byCombinedTSplineSurfaces, vertices=vertexByIndex_2, vector=byCoordinates_2)
