# Dynamo graph VFK33PBU2AHJIHDOMW3NS2YJNGRTQADZ2RUGALOLEWRXK4DM4DTA.dyn "Autodesk.DesignScript.Geometry.TSpline.TSplineSurface.ByBoxLengths(cs, width, length, height, xSpans, ySpans, zSpans, symmetry, inSmoothMode)" (Dynamo 2.19.3.6543)

code_block = CodeBlock { 1; }
byCoordinates = Vector.ByCoordinates(y=code_block, z=code_block)
byOriginVectors = CoordinateSystem.ByOriginVectors(xAxis=byCoordinates)
number_slider = DoubleSlider(6, range=0..10 step 0.1)
number_slider_2 = DoubleSlider(8, range=0..10 step 0.1)
number_slider_3 = DoubleSlider(6, range=0..10 step 0.1)
integer_slider = IntegerSlider(3, range=0..10 step 1)
integer_slider_2 = IntegerSlider(5, range=0..10 step 1)
integer_slider_3 = IntegerSlider(2, range=0..10 step 1)
boolean = BoolSelector(false)
boolean_2 = BoolSelector(false)
boolean_3 = BoolSelector(false)
byAxial = TSpline.TSplineInitialSymmetry.ByAxial(xAxis=boolean, yAxis=boolean_2, zAxis=boolean_3)
boolean_4 = BoolSelector(true)
byBoxLengths = TSpline.TSplineSurface.ByBoxLengths(cs=byOriginVectors, width=number_slider, length=number_slider_2, height=number_slider_3, xSpans=integer_slider, ySpans=integer_slider_2, zSpans=integer_slider_3, symmetry=byAxial, inSmoothMode=boolean_4)
