# Dynamo graph VKEUCM7XUAJICNIO5W65KAFEAZH4TUWVV7BPRMZSI5H5TPFZESTA.dyn "Autodesk.DesignScript.Geometry.Cuboid.ByLengths(width, length, height)" (Dynamo 2.17.0.3255)

number_slider = DoubleSlider(7.3, range=0..20 step 0.1)  # graph input
number_slider_2 = DoubleSlider(11.8, range=0..20 step 0.1)  # graph input
number_slider_3 = DoubleSlider(5.7, range=0..20 step 0.1)  # graph input
byLengths = Cuboid.ByLengths(width=number_slider, length=number_slider_2, height=number_slider_3)
