# Dynamo graph WGMB4D4GWPYAS6YAOVBQIXYPGCBRH3KEF437CWWZGSXVEZXLRGTQ.dyn "Autodesk.DesignScript.Geometry.TSpline.TSplineSurface.ByCylinderRadiusHeight" (Dynamo 2.19.3.6543)

code_block = CodeBlock { 1; }
byCoordinates = Vector.ByCoordinates(z=code_block)
byOriginVectors = CoordinateSystem.ByOriginVectors(xAxis=byCoordinates)
code_block_2 = CodeBlock { 3; 9; 3; }
code_block_3 = CodeBlock { 1; }
byRadial = TSpline.TSplineInitialSymmetry.ByRadial(symmetricFaces=code_block_3)
boolean = BoolSelector(true)
byCylinderRadiusHeight = TSpline.TSplineSurface.ByCylinderRadiusHeight(cs=byOriginVectors, radius=code_block_2.out0, height=code_block_2.out1, radiusSpans=code_block_2.out1, heightSpans=code_block_2.out2, symmetry=byRadial, inSmoothMode=boolean)
