# Dynamo graph WKY3SVAE74IVMZW7MVT4F5TGIUFXAGA2W2FN6Q6PACG3NH6AMVFA.dyn "Autodesk.DesignScript.Geometry.TSpline.TSplineSurface.SubdivideFaces" (Dynamo 2.13.1.3887)

code_block = CodeBlock { 0; 2; }
byCoordinates = Point.ByCoordinates(x=code_block.out0, y=code_block.out0, z=code_block.out1)
code_block_2 = CodeBlock { 8; 4; }
code_block_3 = CodeBlock { 2; }
boolean = BoolSelector(false)
boolean_2 = BoolSelector(false)
boolean_3 = BoolSelector(false)
byAxial = TSpline.TSplineInitialSymmetry.ByAxial(xAxis=boolean, yAxis=boolean_2, zAxis=boolean_3)
boolean_4 = BoolSelector(true)
byBoxLengths = TSpline.TSplineSurface.ByBoxLengths(origin=byCoordinates, width=code_block_2.out0, length=code_block_2.out1, height=code_block_2.out1, xSpans=code_block_3, ySpans=code_block_3, zSpans=code_block_3, symmetry=byAxial, inSmoothMode=boolean_4)
number_slider = DoubleSlider(5, range=0..24 step 1)
faceByIndex = TSpline.TSplineTopology.FaceByIndex(tSplineTopology=byBoxLengths, index=number_slider)
boolean_5 = BoolSelector(false)
subdivideFaces = TSpline.TSplineSurface.SubdivideFaces(tSplineSurface=byBoxLengths, faces=faceByIndex, exact=boolean_5)
UVNFrame = TSpline.TSplineFace.UVNFrame(tSplineFace=faceByIndex)
position = TSpline.TSplineUVNFrame.Position(tSplineUVNFrame=UVNFrame)
