# Dynamo graph WSNXB54TDQEZRTUNRFCTUDK74DHVPQPXBXEYJUZJPW6T2F7XERDQ.dyn "Autodesk.DesignScript.Geometry.TSpline.TSplineSurface.FlattenVertices" (Dynamo 2.13.1.3887)

code_block = CodeBlock { 0; }
byCoordinates = Point.ByCoordinates(x=code_block, y=code_block, z=code_block)
XAxis = Vector.XAxis()
code_block_2 = CodeBlock { 0; }
byCoordinates_2 = Point.ByCoordinates(x=code_block_2, y=code_block_2, z=code_block_2)
code_block_3 = CodeBlock { 8; 0; }
byCoordinates_3 = Point.ByCoordinates(x=code_block_3.out0, y=code_block_3.out0, z=code_block_3.out1)
code_block_4 = CodeBlock { 4; 6; }
boolean = BoolSelector(false)
boolean_2 = BoolSelector(false)
boolean_3 = BoolSelector(false)
byAxial = TSpline.TSplineInitialSymmetry.ByAxial(xAxis=boolean, yAxis=boolean_2, zAxis=boolean_3)
boolean_4 = BoolSelector(true)
byPlaneOriginNormal = TSpline.TSplineSurface.ByPlaneOriginNormal(origin=byCoordinates, normal=XAxis, minCorner=byCoordinates_2, maxCorner=byCoordinates_3, xSpans=code_block_4.out0, ySpans=code_block_4.out1, symmetry=byAxial, inSmoothMode=boolean_4)
code_block_5 = CodeBlock { 0; 34; }
integer_slider = IntegerSlider(7, range=1..8 step 1)
range = Range(start=code_block_5.out0, end=code_block_5.out1, step=integer_slider)
vertexByIndex = TSpline.TSplineTopology.VertexByIndex(tSplineTopology=byPlaneOriginNormal, index=range)
XAxis_2 = Vector.XAxis()
boolean_5 = BoolSelector(true)
moveVertices = TSpline.TSplineSurface.MoveVertices(tSplineSurface=byPlaneOriginNormal, vertices=vertexByIndex, vector=XAxis_2, onSurface=boolean_5)
code_block_6 = CodeBlock { 4; }
translate = Geometry.Translate(geometry=moveVertices, xTranslation=code_block_6)
code_block_7 = CodeBlock { 0..26; }
vertexByIndex_2 = TSpline.TSplineTopology.VertexByIndex(tSplineTopology=translate, index=code_block_7)

# group: Flatten Vertices
flattenVertices = TSpline.TSplineSurface.FlattenVertices(tSplineSurface=translate, vertices=vertexByIndex_2)

UVNFrame = TSpline.TSplineVertex.UVNFrame(tSplineVertex=vertexByIndex_2)
position = TSpline.TSplineUVNFrame.Position(tSplineUVNFrame=UVNFrame)
