# Dynamo graph WYAIBXELRGBNFIV7634PG4K4DE4WCTOFKPGSEPXSDAZLRDEBLBTA.dyn "CoreNodeModels.Input.DoubleSlider" (Dynamo 3.3.0.5104)

number_slider = DoubleSlider(54, range=0..100 step 1)  # graph input
number_slider_2 = DoubleSlider(5, range=0..10 step 1)  # graph input
le = number_slider <= number_slider_2
watch = Watch(le)
