# Dynamo graph Watch3DNodeModels.Watch3D.dyn "Watch3DNodeModels.Watch3D_img" (Dynamo 2.17.0.3255)

number_slider = DoubleSlider(11, range=0..100 step 0.1)
byCenterPointRadius = Circle.ByCenterPointRadius(radius=number_slider)
regularPolygon = Polygon.RegularPolygon(circle=byCenterPointRadius)
code_block = CodeBlock { 20; }
extrudeAsSolid = Curve.ExtrudeAsSolid(curve=regularPolygon, distance=code_block)
boundingBox = Geometry.BoundingBox(geometry=extrudeAsSolid)
toPolySurface = BoundingBox.ToPolySurface(boundingBox=boundingBox)
code_block_2 = CodeBlock(geometry=toPolySurface) { color = Color.ByARGB(100,141,198,217); GeometryColor.ByGeometryColor(geometry, color); }
watch_3d = Watch3D(extrudeAsSolid)
