# Dynamo graph X65A3XAWWVM3XWMAZHZFLL5HTXCJAGYISLC4VHRMPHEV3MBYIRXQ.dyn "Autodesk.DesignScript.Geometry.Solid.BySweep" (Dynamo 2.19.4.6632)

code_block = CodeBlock { 2; }
byWidthLength = Rectangle.ByWidthLength(width=code_block)
code_block_2 = CodeBlock { 0..180..36; }
cos = Math.Cos(angle=code_block_2)
code_block_3 = CodeBlock(x=cos) { x-2; }
code_block_4 = CodeBlock { 0..5..1; }
byCoordinates = Point.ByCoordinates(x=code_block_3, z=code_block_4)
byPoints = NurbsCurve.ByPoints(points=byCoordinates)
bySweep = Solid.BySweep(profile=byWidthLength, path=byPoints)
