# Dynamo graph XGSWLBVZ2TGT6X7FZRUWJDGDSBL7JWKDBQYWEJWO7VZOJPJI7OWQ.dyn "Autodesk.DesignScript.Geometry.TSpline.TSplineSurface.FlattenVertices(vertices, parallelPlane)" (Dynamo 2.19.3.6543)

XAxis = Vector.XAxis()
code_block = CodeBlock { 8; }
byCoordinates = Point.ByCoordinates(x=code_block, y=code_block)
code_block_2 = CodeBlock { 4; 6; }
boolean = BoolSelector(true)
byPlaneOriginNormal = TSpline.TSplineSurface.ByPlaneOriginNormal(normal=XAxis, maxCorner=byCoordinates, xSpans=code_block_2.out0, ySpans=code_block_2.out1, inSmoothMode=boolean)
code_block_3 = CodeBlock { 0..28..7; }
vertexByIndex = TSpline.TSplineTopology.VertexByIndex(tSplineTopology=byPlaneOriginNormal, index=code_block_3)
XAxis_2 = Vector.XAxis()
boolean_2 = BoolSelector(true)
moveVertices = TSpline.TSplineSurface.MoveVertices(tSplineSurface=byPlaneOriginNormal, vertices=vertexByIndex, vector=XAxis_2, onSurface=boolean_2)
code_block_4 = CodeBlock { 10; }
translate = Geometry.Translate(geometry=moveVertices, xTranslation=code_block_4)
code_block_5 = CodeBlock { 0..34; }
vertexByIndex_2 = TSpline.TSplineTopology.VertexByIndex(tSplineTopology=translate, index=code_block_5)
code_block_6 = CodeBlock { -0.9; 0; -0.4; }
byCoordinates_2 = Vector.ByCoordinates(x=code_block_6.out0, y=code_block_6.out1, z=code_block_6.out2)
byOriginNormal = Plane.ByOriginNormal(normal=byCoordinates_2)
flattenVertices = TSpline.TSplineSurface.FlattenVertices(tSplineSurface=translate, vertices=vertexByIndex_2, parallelPlane=byOriginNormal)
