# Dynamo graph XTER6KGCJ3OP43RH5L4IEBVIW7JTSDB46DYI7BVE2UMG3DXB7HLQ.dyn "Autodesk.DesignScript.Geometry.TSpline.TSplineSurface.ExtrudeFacesAlongCurve" (Dynamo 2.19.3.6543)

code_block = CodeBlock { 8; 5; 1; }
byOrigin = CoordinateSystem.ByOrigin(x=code_block.out0, y=code_block.out1, z=code_block.out2)
code_block_2 = CodeBlock { 6; 10; 1; }
code_block_3 = CodeBlock { 4; 6; 1; }
boolean = BoolSelector(true)
boolean_2 = BoolSelector(true)
boolean_3 = BoolSelector(false)
byAxial = TSpline.TSplineInitialSymmetry.ByAxial(xAxis=boolean, yAxis=boolean_2, zAxis=boolean_3)
boolean_4 = BoolSelector(true)
byBoxLengths = TSpline.TSplineSurface.ByBoxLengths(cs=byOrigin, width=code_block_2.out0, length=code_block_2.out1, height=code_block_2.out2, xSpans=code_block_3.out0, ySpans=code_block_3.out1, zSpans=code_block_3.out2, symmetry=byAxial, inSmoothMode=boolean_4)
integer_slider = IntegerSlider(3, range=0..159 step 1)
faceByIndex = TSpline.TSplineTopology.FaceByIndex(tSplineTopology=byBoxLengths, index=integer_slider)
code_block_4 = CodeBlock { point1 = Point.ByCoordinates(0, 0, 0); point2 = Point.ByCoordinates(0, 0, 6); point3 = Point.ByCoordinates(-1, 0, 8); }
list_create = List.Create(item0=code_block_4.point1, item1=code_block_4.point2, item2=code_block_4.point3)
byPoints = NurbsCurve.ByPoints(points=list_create)
code_block_5 = CodeBlock { 5; }
extrudeFacesAlongCurve = TSpline.TSplineSurface.ExtrudeFacesAlongCurve(tSplineSurface=byBoxLengths, faces=faceByIndex, curve=byPoints, spans=code_block_5)
