# Dynamo graph Z7RCGSZ7PG327WNJNF5LAVZMVCYSSBNPUFE666HLMLY4QCDT4TDQ.dyn "Autodesk.DesignScript.Geometry.Geometry.Translate" (Dynamo 2.19.4.6632)

code_block = CodeBlock { 8; 2; 5; }
byCoordinates = Point.ByCoordinates(x=code_block.out0, y=code_block.out1, z=code_block.out2)
code_block_2 = CodeBlock { 5; 2; 8; }
byCoordinates_2 = Point.ByCoordinates(x=code_block_2.out0, y=code_block_2.out1, z=code_block_2.out2)
byPointsRadius = Cone.ByPointsRadius(startPoint=byCoordinates, endPoint=byCoordinates_2, startRadius=code_block_2.out0)
number_slider = DoubleSlider(4.5, range=0..100 step 0.1)  # graph input
number_slider_2 = DoubleSlider(0, range=0..100 step 0.1)  # graph input
number_slider_3 = DoubleSlider(6, range=0..100 step 0.1)  # graph input
translate = Geometry.Translate(geometry=byPointsRadius, xTranslation=number_slider, yTranslation=number_slider_2, zTranslation=number_slider_3)
