# Dynamo graph ZBLSFRQNVI3VPC3KTS3XZI6VXSAJAON2ETVE46OLR7NMYOY6INXA.dyn (Dynamo 2.19.3.6543)

file_path = Filename("..\SKULL.tss")
boolean = BoolSelector(true)
importFromTSS = TSpline.TSplineSurface.ImportFromTSS(filePath=file_path, inSmoothMode=boolean)
