# Dynamo graph ZLORG7PG4XWDBYXJHH7YVPDCIU4QYMZWAMABFPVWNAZ7VTQTX2YQ.dyn "Autodesk.DesignScript.Geometry.TSpline.TSplineSurface.CreaseVertices" (Dynamo 2.19.3.6543)

byCoordinates = Point.ByCoordinates()
number_slider = DoubleSlider(50, range=0..150 step 5)
byCoordinates_2 = Point.ByCoordinates(y=number_slider)
number_slider_2 = DoubleSlider(95, range=0..150 step 5)
number_slider_3 = DoubleSlider(45, range=0..150 step 5)
byCoordinates_3 = Point.ByCoordinates(x=number_slider_2, y=number_slider_3)
number_slider_4 = DoubleSlider(34.972, range=0..150 step 5)
number_slider_5 = DoubleSlider(80.969, range=0..150 step 5)
byCoordinates_4 = Point.ByCoordinates(y=number_slider_4, z=number_slider_5)
number_slider_6 = DoubleSlider(70, range=0..150 step 5)
byCoordinates_5 = Point.ByCoordinates(z=number_slider_6)
number_slider_7 = DoubleSlider(85, range=0..150 step 5)
byCoordinates_6 = Point.ByCoordinates(x=number_slider_7)
code_block = CodeBlock(point1=byCoordinates, point2=byCoordinates_2, point3=byCoordinates_3, point4=byCoordinates_4, point5=byCoordinates_5, point6=byCoordinates_6)
# ---------- code_block.designscript (11 lines) ----------
line1 = Line.ByStartPointEndPoint(point1, point2);
line2 = Line.ByStartPointEndPoint(point2, point3);
line3 = Line.ByStartPointEndPoint(point2, point4);
line4 = Line.ByStartPointEndPoint(point1, point5);
line5 = Line.ByStartPointEndPoint(point4, point5);
line6 = Line.ByStartPointEndPoint(point6, point1);
line7 = Line.ByStartPointEndPoint(point6, point1);
line8 = Line.ByStartPointEndPoint(point6, point3);
line9 = Line.ByStartPointEndPoint(point4, point3);
line10 = Line.ByStartPointEndPoint(point2, point1);
Line11 = Line.ByStartPointEndPoint(point5, point6);
# ----------------------------------------
join = List.Join(list0=code_block.line1, list1=code_block.line2, list2=code_block.line3, list3=code_block.Line11, list4=code_block.line5, list5=code_block.line6, list6=code_block.line7, list7=code_block.line8, list8=code_block.line9)
code_block_2 = CodeBlock { 4; }
code_block_3 = CodeBlock { 0.01; }
boolean = BoolSelector(false)
boolean_2 = BoolSelector(true)
buildFromLines = TSpline.TSplineSurface.BuildFromLines(lines=join, maxFaceValence=code_block_2, snappingTolerance=code_block_3, creaseOuterVertices=boolean, inSmoothMode=boolean_2)
code_block_4 = CodeBlock { 125; }
translate = Geometry.Translate(geometry=buildFromLines, xTranslation=code_block_4)
code_block_5 = CodeBlock { 1; }
vertexByIndex = TSpline.TSplineTopology.VertexByIndex(tSplineTopology=buildFromLines, index=code_block_5)
creaseVertices = TSpline.TSplineSurface.CreaseVertices(tSplineSurface=translate, vertices=vertexByIndex)
