# Dynamo graph ZQ5G3XLBM6AP62MCXAVZY7HD4ZQ7VGZPQJXEUD75YACYNU2RIDHQ.dyn (Dynamo 1.1.0.2093)

origin = Point.Origin()
byOriginVectors = CoordinateSystem.ByOriginVectors(origin=origin)
code_block = CodeBlock { Point.ByCoordinates(-1,2,0); }
code_block_2 = CodeBlock { 1; }
byCoordinates = Point.ByCoordinates(x=code_block_2, y=code_block_2)
number_slider = DoubleSlider(6, range=1..10 step 0.1)
byCoordinates_2 = Point.ByCoordinates(x=number_slider, y=number_slider)
scale = CoordinateSystem.Scale(byOriginVectors, code_block, byCoordinates, byCoordinates_2)
distanceTo = Geometry.DistanceTo(geometry=byCoordinates, other=byCoordinates_2)
watch = Watch(distanceTo)
