# Dynamo graph %.dyn (Dynamo 2.19.0.5742)

number_slider = DoubleSlider(49, range=0..100 step 1)  # graph input
number_slider_2 = DoubleSlider(5, range=0..10 step 1)  # graph input
mod = number_slider % number_slider_2
watch = Watch(mod)
