# Dynamo graph Autodesk.DesignScript.Geometry.Curve.ByIsoCurveOnSurface.dyn "ByIsoCurveOnSurface" (Dynamo 2.0.1.5055)

code_block = CodeBlock { 0..25..#5; }
byCoordinates = Point.ByCoordinates(x=code_block, y=code_block, lacing=CrossProduct)
asVector = Point.AsVector(point=byCoordinates)
length = Vector.Length(vector=asVector)
random = Math.Random(seed=length)
translate = Geometry.Translate(geometry=byCoordinates, zTranslation=random)
byPoints = NurbsSurface.ByPoints(points=translate)
number_slider = DoubleSlider(1, range=0..1 step 1)  # graph input
number_slider_2 = DoubleSlider(0.37, range=0..1 step 0.01)  # graph input
byIsoCurveOnSurface = Curve.ByIsoCurveOnSurface(baseSurface=byPoints, direction=number_slider, parameter=number_slider_2)
