# Dynamo graph Autodesk.DesignScript.Geometry.Topology.Vertices.dyn "Vertices" (Dynamo 2.0.1.5055)

byCorners = Cuboid.ByCorners()
vertices = Topology.Vertices(topology=byCorners)
watch = Watch(vertices)
pointGeometry = Vertex.PointGeometry(vertex=watch)
code_block = CodeBlock(geometry=byCorners) { color = Color.ByARGB(100,141,198,217); GeometryColor.ByGeometryColor(geometry, color); }
