# Dynamo graph Autodesk.DesignScript.Geometry.Vector.YAxis.dyn "YAxis" (Dynamo 2.0.1.5055)

origin = Point.Origin()
YAxis = Vector.YAxis()
code_block = CodeBlock { 10; }
byStartPointDirectionLength = Line.ByStartPointDirectionLength(startPoint=origin, direction=YAxis, length=code_block)
