# Dynamo graph DSCore.List.IsUniformDepth.dyn (Dynamo 2.19.0.5742)

code_block = CodeBlock { 0..12..#6; }
create = List.Create(item0=code_block, item1=code_block)
create_2 = List.Create(item0=code_block, item1=create)
watch = Watch(create_2)
isUniformDepth = List.IsUniformDepth(list=watch)
watch_2 = Watch(isUniformDepth)
create_3 = List.Create(item0=code_block, item1=code_block, item2=code_block)
watch_3 = Watch(create_3)
isUniformDepth_2 = List.IsUniformDepth(list=watch_3)
watch_4 = Watch(isUniformDepth_2)
