# Dynamo graph DesignScript.Builtin.Dictionary.RemoveKeys.dyn (Dynamo 2.17.0.3255)

code_block = CodeBlock { ["foo","bar"]; [1,2]; }
byKeysValues = DesignScript.Builtin.Dictionary.ByKeysValues(keys=code_block.out0, values=code_block.out1)
code_block_2 = CodeBlock { "bar"; }
removeKeys = DesignScript.Builtin.Dictionary.RemoveKeys(dictionary=byKeysValues, keys=code_block_2)
