# Dynamo graph EWHQFBJJR5GL3IN7LJ7T7SOY4G24EIBASTHDIRIYQ27HIKC2MGYQ.dyn "Autodesk.DesignScript.Geometry.Geometry.Scale" (Dynamo 2.19.4.6632)

origin = Point.Origin()
code_block = CodeBlock { 5; 2; 8; }
byCoordinates = Point.ByCoordinates(x=code_block.out0, y=code_block.out1, z=code_block.out2)
byPointsRadius = Cone.ByPointsRadius(startPoint=origin, endPoint=byCoordinates, startRadius=code_block.out0)
YZ = Plane.YZ()
number_slider = DoubleSlider(2, range=0.1..5 step 0.1)  # graph input
number_slider_2 = DoubleSlider(1.4, range=0.1..5 step 0.1)  # graph input
number_slider_3 = DoubleSlider(0.9, range=0.1..5 step 0.1)  # graph input
scale = Geometry.Scale(geometry=byPointsRadius, plane=YZ, xamount=number_slider, yamount=number_slider_2, zamount=number_slider_3)
