# Dynamo graph List.Equals.dyn (Dynamo 2.19.0.5742)

number_slider = DoubleSlider(2, range=0..5 step 1)  # graph input
byCenterPointRadius = Circle.ByCenterPointRadius(radius=number_slider)
radius = Circle.Radius(circle=byCenterPointRadius)
number_slider_2 = DoubleSlider(1, range=0..5 step 1)  # graph input
byCenterPointRadius_2 = Circle.ByCenterPointRadius(radius=number_slider_2)
radius_2 = Circle.Radius(circle=byCenterPointRadius_2)
equals = List.Equals(object=radius, otherObject=radius_2)
watch = Watch(equals)
