# Dynamo graph UCHS6CZOTWQLL24MRS4TPZS4UDBURP3SZIIW4TRSPQVRTMYBAVVA.dyn "Autodesk.DesignScript.Geometry.TSpline.TSplineSurface.UncreaseVertices" (Dynamo 2.19.3.6543)

code_block = CodeBlock { 20; }
byCoordinates = Point.ByCoordinates(x=code_block, y=code_block)
boolean = BoolSelector(true)
byPlaneOriginNormal = TSpline.TSplineSurface.ByPlaneOriginNormal(maxCorner=byCoordinates, inSmoothMode=boolean)
code_block_2 = CodeBlock { [2,8,6]; }
vertexByIndex = TSpline.TSplineTopology.VertexByIndex(tSplineTopology=byPlaneOriginNormal, index=code_block_2)
uncreaseVertices = TSpline.TSplineSurface.UncreaseVertices(tSplineSurface=byPlaneOriginNormal, vertices=vertexByIndex)
code_block_3 = CodeBlock { 0..8; }
vertexByIndex_2 = TSpline.TSplineTopology.VertexByIndex(tSplineTopology=byPlaneOriginNormal, index=code_block_3)
UVNFrame = TSpline.TSplineVertex.UVNFrame(tSplineVertex=vertexByIndex_2)
position = TSpline.TSplineUVNFrame.Position(tSplineUVNFrame=UVNFrame)
