# Dynamo graph VK6GQ42BUN4KBY4KJUYSHBYUP6QQDHLXPGOYWHT6TYV3KTFHSJOQ.dyn (Dynamo 1.1.0.2093)

origin = Point.Origin()
byOriginVectors = CoordinateSystem.ByOriginVectors(origin=origin)
number_slider = DoubleSlider(5.2, range=0..10 step 0.1)
number_slider_2 = DoubleSlider(3.4, range=0..10 step 0.1)
number_slider_3 = DoubleSlider(3.9, range=0..10 step 0.1)
scale = CoordinateSystem.Scale(byOriginVectors, number_slider, number_slider_2, number_slider_3)
scaleFactor = CoordinateSystem.ScaleFactor(scale)
watch = Watch(scaleFactor)
