# Dynamo graph Autodesk.DesignScript.Geometry.Surface.ApproximateWithTolerance.dyn "ApproximateWithTolerance" (Dynamo 2.0.1.5055)

number_slider = DoubleSlider(6, range=3..10 step 1)  # graph input
code_block = CodeBlock(a=number_slider) { 0..360..360/(a-1); }
randomList = Math.RandomList(amount=number_slider)
code_block_2 = CodeBlock(x=randomList) { x*5; }
randomList_2 = Math.RandomList(amount=number_slider)
code_block_3 = CodeBlock(x=randomList_2) { x*5; }
byCylindricalCoordinates = Point.ByCylindricalCoordinates(angle=code_block, elevation=code_block_2, radius=code_block_3)
boolean = BoolSelector(true)  # graph input
byPoints = NurbsCurve.ByPoints(points=byCylindricalCoordinates, closeCurve=boolean)
byPatch = Surface.ByPatch(closedCurve=byPoints)
approximateWithTolerance = Surface.ApproximateWithTolerance(surface=byPatch)
