# Dynamo graph DSCore.String.LastIndexOf.dyn "LastIndexOf" (Dynamo 2.0.1.5055)

string = StringInput("Hello World")  # graph input
string_2 = StringInput("o")  # graph input
boolean = BoolSelector(false)  # graph input
lastIndexOf = String.LastIndexOf(str=string, searchFor=string_2, ignoreCase=boolean)
watch = Watch(lastIndexOf)
