# Dynamo graph Autodesk.DesignScript.Geometry.Mesh.Sphere.dyn (Dynamo 2.13.1.3887)
# packages: MeshToolkit 3.0.0

code_block = CodeBlock { 2; }
byCoordinates = Point.ByCoordinates(x=code_block, y=code_block, z=code_block)
code_block_2 = CodeBlock { 2; 10; }
boolean = BoolSelector(true)
sphere = Mesh.Sphere(origin=byCoordinates, radius=code_block_2.out0, divisions=code_block_2.out1, icosphere=boolean)
code_block_3 = CodeBlock { 8; 2; }
byCoordinates_2 = Point.ByCoordinates(x=code_block_3.out0, y=code_block_3.out1, z=code_block_3.out1)
code_block_4 = CodeBlock { 2; 10; }
boolean_2 = BoolSelector(false)
sphere_2 = Mesh.Sphere(origin=byCoordinates_2, radius=code_block_4.out0, divisions=code_block_4.out1, icosphere=boolean_2)
