# Dynamo graph Autodesk.DesignScript.Geometry.NurbsSurface.IsPeriodicInU.dyn "IsPeriodicInU" (Dynamo 2.0.1.5055)

code_block = CodeBlock { 0..10..#20; }
code_block_2 = CodeBlock(x=code_block) { x*2; }
byCoordinates = Point.ByCoordinates(x=code_block_2, y=code_block_2, lacing=CrossProduct)
ZAxis = Vector.ZAxis()
count = List.Count(list=byCoordinates)
randomList = Math.RandomList(amount=count)
scale = Vector.Scale(vector=ZAxis, scale_factor=randomList)
translate = Geometry.Translate(geometry=byCoordinates, direction=scale)
byPoints = NurbsSurface.ByPoints(points=translate)
isPeriodicInU = NurbsSurface.IsPeriodicInU(nurbsSurface=byPoints)
watch = Watch(isPeriodicInU)
