# Dynamo graph DSOffice.Data.ExportCSV.dyn "DSOffice.Data.ExportCSV_img" (Dynamo 2.17.0.3255)

file_path = Filename("..\..\..\..\..\..\..\..\..\..\Temp\sample.csv")
code_block = CodeBlock { [["value1,5"],["value2,10"],["value3",12]]; }
exportCSV = Data.ExportCSV(filePath=file_path, data=code_block)
