# Dynamo graph GD5OJ5UNM2WTBIO7EKGVKBLXL5UMKVOXBJKW2YFKOPVHUIHDCIFA.dyn (Dynamo 2.19.3.6543)

file_path = Filename("..\SKULL.tss")
file_from_path = FileObject(path=file_path)
boolean = BoolSelector(true)
importFromTSS = TSpline.TSplineSurface.ImportFromTSS(file=file_from_path, inSmoothMode=boolean)
