# Dynamo graph SFTUBFPMM3AWPUQ6E6XPGTDHXANNIVC3ZHSMIP63ZGMSHIEQMWFQ.dyn "Autodesk.DesignScript.Geometry.TSpline.TSplineSurface.ByPlaneThreePoints" (Dynamo 2.19.3.6543)

# group: randomly generated 3 points
code_block = CodeBlock { 9; }
randomList = Math.RandomList(amount=code_block)
code_block_2 = CodeBlock { 20; }
remapRange = Math.RemapRange(numbers=randomList, newMax=code_block_2)
code_block_3 = CodeBlock { 3; }
chop = List.Chop(list=remapRange, lengths=code_block_3)
transpose = List.Transpose(lists=chop)
code_block_4 = CodeBlock(x=transpose) { x[0]; x[1]; x[2]; }
byCoordinates = Point.ByCoordinates(x=code_block_4.out0, y=code_block_4.out1, z=code_block_4.out2, lacing=Shortest)
code_block_5 = CodeBlock(x=byCoordinates) { x[0]; x[1]; x[2]; }

code_block_6 = CodeBlock { 10; 20; }
byCoordinates_2 = Point.ByCoordinates(x=code_block_6.out0, y=code_block_6.out1)
code_block_7 = CodeBlock { 3; 4; }
boolean = BoolSelector(false)
byAxial = TSpline.TSplineInitialSymmetry.ByAxial(xAxis=boolean, yAxis=boolean, zAxis=boolean)
boolean_2 = BoolSelector(true)
byPlaneThreePoints = TSpline.TSplineSurface.ByPlaneThreePoints(p1=code_block_5.out0, p2=code_block_5.out1, p3=code_block_5.out2, maxCorner=byCoordinates_2, xSpans=code_block_7.out0, ySpans=code_block_7.out1, symmetry=byAxial, inSmoothMode=boolean_2)
