# Dynamo graph Autodesk.DesignScript.Geometry.Curve.TrimByParameter.dyn "TrimByParameter" (Dynamo 2.0.1.5055)

code_block = CodeBlock { 6; }
randomList = Math.RandomList(amount=code_block)
code_block_2 = CodeBlock(x=randomList) { x*10; }
randomList_2 = Math.RandomList(amount=code_block)
code_block_3 = CodeBlock(x=randomList_2) { x*10; }
byCoordinates = Point.ByCoordinates(x=code_block_2, y=code_block_3)
byControlPoints = NurbsCurve.ByControlPoints(points=byCoordinates)
number_slider = DoubleSlider(0.26, range=0..1 step 0.01)  # graph input
number_slider_2 = DoubleSlider(0.86, range=0..1 step 0.01)  # graph input
trimByParameter = Curve.TrimByParameter(curve=byControlPoints, startParameter=number_slider, endParameter=number_slider_2)
