# Dynamo graph Autodesk.DesignScript.Geometry.NurbsSurface.ByControlPoints.dyn "ByControlPoints" (Dynamo 2.0.1.5055)

code_block = CodeBlock { 0..25..#10; }
byCoordinates = Point.ByCoordinates(x=code_block, y=code_block, lacing=CrossProduct)
ZAxis = Vector.ZAxis()
count = List.Count(list=byCoordinates)
randomList = Math.RandomList(amount=count)
code_block_2 = CodeBlock(x=randomList) { x*3; }
scale = Vector.Scale(vector=ZAxis, scale_factor=code_block_2)
translate = Geometry.Translate(geometry=byCoordinates, direction=scale)
code_block_3 = CodeBlock { 3; 3; }
byControlPoints = NurbsSurface.ByControlPoints(controlVertices=translate, uDegree=code_block_3.out0, vDegree=code_block_3.out1)
