# Dynamo graph Autodesk.DesignScript.Geometry.Point.ByCylindricalCoordinates.dyn (Dynamo 2.17.0.3255)

origin = Point.Origin()
byOrigin = CoordinateSystem.ByOrigin(origin=origin)
number_slider = DoubleSlider(270, range=0..360 step 30)  # graph input
number_slider_2 = DoubleSlider(9.1, range=0..10 step 0.1)  # graph input
code_block = CodeBlock(a=number_slider, b=number_slider_2) { 0..a..10; 0..b..1; }
number_slider_3 = DoubleSlider(3, range=0..10 step 1)  # graph input
byCylindricalCoordinates = Point.ByCylindricalCoordinates(coordinateSystem=byOrigin, angle=code_block.out0, elevation=code_block.out1, radius=number_slider_3, lacing=CrossProduct)
