# Dynamo graph Autodesk.DesignScript.Geometry.Solid.ByUnion.dyn "ByUnion" (Dynamo 2.0.1.5055)

number_slider = DoubleSlider(0.4, range=-3..3 step 0.1)  # graph input
number_slider_2 = DoubleSlider(-0.2, range=-3..3 step 0.1)  # graph input
number_slider_3 = DoubleSlider(0.8, range=-3..3 step 0.1)  # graph input
byCoordinates = Point.ByCoordinates(x=number_slider, y=number_slider_2, z=number_slider_3)
number_slider_4 = DoubleSlider(0.5, range=0..3 step 0.1)  # graph input
byCenterPointRadius = Sphere.ByCenterPointRadius(centerPoint=byCoordinates, radius=number_slider_4)
byLengths = Cuboid.ByLengths()
create = List.Create(item0=byCenterPointRadius, item1=byLengths)
byUnion = Solid.ByUnion(solids=create)
