# Dynamo graph DSCore.IO.FileSystem.FileExtension.dyn "DSCore.IO.FileSystem.FileExtension_img" (Dynamo 2.17.0.3255)

file_path = Filename("..\..\..\..\..\..\..\..\..\..\Temp\Sample.txt")
directoryName = FileSystem.DirectoryName(path=file_path)
watch = Watch(directoryName)
fileName = FileSystem.FileName(path=file_path)
watch_2 = Watch(fileName)
fileExtension = FileSystem.FileExtension(path=file_path)
watch_3 = Watch(fileExtension)
