# Dynamo graph UZBX3TZTQ23FP32HELAYI7UOVGU7J6ACDZ5C3DTCYCIVJOHYWCCQ.dyn "Autodesk.DesignScript.Geometry.TSpline.TSplineSurface.BuildFromLines" (Dynamo 2.19.3.6543)

# group: Lines Grid - Set 2
lines_grid_set_2 = CodeBlock()
# ---------- lines_grid_set_2.designscript (96 lines) ----------
[Line.ByStartPointEndPoint(Point.ByCoordinates(-55688.0,-1369.0,4500.0),(Point.ByCoordinates(-60188.0,-1369.0,4500.0))),
Line.ByStartPointEndPoint(Point.ByCoordinates(-55688.0,-10369.0,4500.0),(Point.ByCoordinates(-55688.0,-5869.0,4500.0))),
Line.ByStartPointEndPoint(Point.ByCoordinates(-64688.0,-10369.0,4500.0),(Point.ByCoordinates(-62438.0,-10369.0,4500.0))),
Line.ByStartPointEndPoint(Point.ByCoordinates(-64688.0,-1369.0,4500.0),(Point.ByCoordinates(-64688.0,-5869.0,4500.0))),
Line.ByStartPointEndPoint(Point.ByCoordinates(-60188.0,-1369.0,4500.0),(Point.ByCoordinates(-60188.0,-5869.0,4500.0))),
Line.ByStartPointEndPoint(Point.ByCoordinates(-64688.0,-5869.0,4500.0),(Point.ByCoordinates(-62438.0,-5869.0,4500.0))),
Line.ByStartPointEndPoint(Point.ByCoordinates(-64688.0,-5869.0,4500.0),(Point.ByCoordinates(-64688.0,-10369.0,4500.0))),
Line.ByStartPointEndPoint(Point.ByCoordinates(-60188.0,-5869.0,4500.0),(Point.ByCoordinates(-55688.0,-5869.0,4500.0))),
Line.ByStartPointEndPoint(Point.ByCoordinates(-60188.0,-5869.0,4500.0),(Point.ByCoordinates(-60188.0,-10369.0,4500.0))),
Line.ByStartPointEndPoint(Point.ByCoordinates(-55688.0,-5869.0,4500.0),(Point.ByCoordinates(-55688.0,-1369.0,4500.0))),
Line.ByStartPointEndPoint(Point.ByCoordinates(-60188.0,-10369.0,4500.0),(Point.ByCoordinates(-55688.0,-10369.0,4500.0))),
Line.ByStartPointEndPoint(Point.ByCoordinates(-60188.0,-1369.0,4500.0),(Point.ByCoordinates(-65266.0,3708.0,4500.0))),
Line.ByStartPointEndPoint(Point.ByCoordinates(-60188.0,-1369.0,4500.0),(Point.ByCoordinates(-54490.0,4327.0,4500.0))),
Line.ByStartPointEndPoint(Point.ByCoordinates(-55688.0,-1369.0,4500.0),(Point.ByCoordinates(-52240.0,2077.0,4500.0))),
Line.ByStartPointEndPoint(Point.ByCoordinates(-52240.0,2077.0,4500.0),(Point.ByCoordinates(-54490.0,4327.0,4500.0))),
Line.ByStartPointEndPoint(Point.ByCoordinates(-64688.0,-1369.0,4500.0),(Point.ByCoordinates(-67516.0,1458.0,4500.0))),
Line.ByStartPointEndPoint(Point.ByCoordinates(-67516.0,1458.0,4500.0),(Point.ByCoordinates(-66391.0,2583.0,4500.0))),
Line.ByStartPointEndPoint(Point.ByCoordinates(-60188.0,-1369.0,4500.0),(Point.ByCoordinates(-60188.0,2630.0,4500.0))),
Line.ByStartPointEndPoint(Point.ByCoordinates(-60188.0,2630.0,4500.0),(Point.ByCoordinates(-63266.0,5708.0,4500.0))),
Line.ByStartPointEndPoint(Point.ByCoordinates(-63266.0,5708.0,4500.0),(Point.ByCoordinates(-65266.0,3708.0,4500.0))),
Line.ByStartPointEndPoint(Point.ByCoordinates(-60188.0,2630.0,4500.0),(Point.ByCoordinates(-56490.0,6327.0,4500.0))),
Line.ByStartPointEndPoint(Point.ByCoordinates(-56490.0,6327.0,4500.0),(Point.ByCoordinates(-54490.0,4327.0,4500.0))),
Line.ByStartPointEndPoint(Point.ByCoordinates(-67516.0,1458.0,4500.0),(Point.ByCoordinates(-69142.0,3085.0,4500.0))),
Line.ByStartPointEndPoint(Point.ByCoordinates(-69142.0,3085.0,4500.0),(Point.ByCoordinates(-68017.0,4210.0,4500.0))),
Line.ByStartPointEndPoint(Point.ByCoordinates(-66892.0,5335.0,4500.0),(Point.ByCoordinates(-65266.0,3708.0,4500.0))),
Line.ByStartPointEndPoint(Point.ByCoordinates(-66892.0,5335.0,4500.0),(Point.ByCoordinates(-64892.0,7335.0,4500.0))),
Line.ByStartPointEndPoint(Point.ByCoordinates(-64892.0,7335.0,4500.0),(Point.ByCoordinates(-63266.0,5708.0,4500.0))),
Line.ByStartPointEndPoint(Point.ByCoordinates(-62438.0,-1369.0,4500.0),(Point.ByCoordinates(-62438.0,-5869.0,4500.0))),
Line.ByStartPointEndPoint(Point.ByCoordinates(-62438.0,-1369.0,4500.0),(Point.ByCoordinates(-66391.0,2583.0,4500.0))),
Line.ByStartPointEndPoint(Point.ByCoordinates(-66391.0,2583.0,4500.0),(Point.ByCoordinates(-65266.0,3708.0,4500.0))),
Line.ByStartPointEndPoint(Point.ByCoordinates(-66391.0,2583.0,4500.0),(Point.ByCoordinates(-68017.0,4210.0,4500.0))),
Line.ByStartPointEndPoint(Point.ByCoordinates(-68017.0,4210.0,4500.0),(Point.ByCoordinates(-66892.0,5335.0,4500.0))),
Line.ByStartPointEndPoint(Point.ByCoordinates(-55688.0,-1369.0,0.0),(Point.ByCoordinates(-60188.0,-1369.0,0.0))),
Line.ByStartPointEndPoint(Point.ByCoordinates(-55688.0,-10369.0,0.0),(Point.ByCoordinates(-55688.0,-5869.0,0.0))),
Line.ByStartPointEndPoint(Point.ByCoordinates(-64688.0,-10369.0,0.0),(Point.ByCoordinates(-62438.0,-10369.0,0.0))),
Line.ByStartPointEndPoint(Point.ByCoordinates(-64688.0,-1369.0,0.0),(Point.ByCoordinates(-64688.0,-5869.0,0.0))),
Line.ByStartPointEndPoint(Point.ByCoordinates(-60188.0,-1369.0,0.0),(Point.ByCoordinates(-60188.0,-5869.0,0.0))),
Line.ByStartPointEndPoint(Point.ByCoordinates(-64688.0,-5869.0,0.0),(Point.ByCoordinates(-62438.0,-5869.0,0.0))),
Line.ByStartPointEndPoint(Point.ByCoordinates(-64688.0,-5869.0,0.0),(Point.ByCoordinates(-64688.0,-10369.0,0.0))),
Line.ByStartPointEndPoint(Point.ByCoordinates(-60188.0,-5869.0,0.0),(Point.ByCoordinates(-55688.0,-5869.0,0.0))),
Line.ByStartPointEndPoint(Point.ByCoordinates(-60188.0,-5869.0,0.0),(Point.ByCoordinates(-60188.0,-10369.0,0.0))),
Line.ByStartPointEndPoint(Point.ByCoordinates(-55688.0,-5869.0,0.0),(Point.ByCoordinates(-55688.0,-1369.0,0.0))),
Line.ByStartPointEndPoint(Point.ByCoordinates(-60188.0,-10369.0,0.0),(Point.ByCoordinates(-55688.0,-10369.0,0.0))),
Line.ByStartPointEndPoint(Point.ByCoordinates(-60188.0,-1369.0,0.0),(Point.ByCoordinates(-65266.0,3708.0,0.0))),
Line.ByStartPointEndPoint(Point.ByCoordinates(-60188.0,-1369.0,0.0),(Point.ByCoordinates(-54490.0,4327.0,0.0))),
Line.ByStartPointEndPoint(Point.ByCoordinates(-55688.0,-1369.0,0.0),(Point.ByCoordinates(-52240.0,2077.0,0.0))),
Line.ByStartPointEndPoint(Point.ByCoordinates(-52240.0,2077.0,0.0),(Point.ByCoordinates(-54490.0,4327.0,0.0))),
Line.ByStartPointEndPoint(Point.ByCoordinates(-64688.0,-1369.0,0.0),(Point.ByCoordinates(-67516.0,1458.0,0.0))),
Line.ByStartPointEndPoint(Point.ByCoordinates(-67516.0,1458.0,0.0),(Point.ByCoordinates(-66391.0,2583.0,0.0))),
Line.ByStartPointEndPoint(Point.ByCoordinates(-60188.0,-1369.0,0.0),(Point.ByCoordinates(-60188.0,2630.0,0.0))),
Line.ByStartPointEndPoint(Point.ByCoordinates(-60188.0,2630.0,0.0),(Point.ByCoordinates(-63266.0,5708.0,0.0))),
Line.ByStartPointEndPoint(Point.ByCoordinates(-63266.0,5708.0,0.0),(Point.ByCoordinates(-65266.0,3708.0,0.0))),
Line.ByStartPointEndPoint(Point.ByCoordinates(-60188.0,2630.0,0.0),(Point.ByCoordinates(-56490.0,6327.0,0.0))),
Line.ByStartPointEndPoint(Point.ByCoordinates(-56490.0,6327.0,0.0),(Point.ByCoordinates(-54490.0,4327.0,0.0))),
Line.ByStartPointEndPoint(Point.ByCoordinates(-67516.0,1458.0,0.0),(Point.ByCoordinates(-69142.0,3085.0,0.0))),
Line.ByStartPointEndPoint(Point.ByCoordinates(-69142.0,3085.0,0.0),(Point.ByCoordinates(-68017.0,4210.0,0.0))),
Line.ByStartPointEndPoint(Point.ByCoordinates(-66892.0,5335.0,0.0),(Point.ByCoordinates(-65266.0,3708.0,0.0))),
Line.ByStartPointEndPoint(Point.ByCoordinates(-66892.0,5335.0,0.0),(Point.ByCoordinates(-64892.0,7335.0,0.0))),
Line.ByStartPointEndPoint(Point.ByCoordinates(-64892.0,7335.0,0.0),(Point.ByCoordinates(-63266.0,5708.0,0.0))),
Line.ByStartPointEndPoint(Point.ByCoordinates(-62438.0,-1369.0,0.0),(Point.ByCoordinates(-62438.0,-5869.0,0.0))),
Line.ByStartPointEndPoint(Point.ByCoordinates(-62438.0,-1369.0,0.0),(Point.ByCoordinates(-64688.0,-1369.0,0.0))),
Line.ByStartPointEndPoint(Point.ByCoordinates(-62438.0,-5869.0,0.0),(Point.ByCoordinates(-60188.0,-5869.0,0.0))),
Line.ByStartPointEndPoint(Point.ByCoordinates(-62438.0,-5869.0,0.0),(Point.ByCoordinates(-62438.0,-10369.0,0.0))),
Line.ByStartPointEndPoint(Point.ByCoordinates(-62438.0,-10369.0,0.0),(Point.ByCoordinates(-60188.0,-10369.0,0.0))),
Line.ByStartPointEndPoint(Point.ByCoordinates(-62438.0,-1369.0,0.0),(Point.ByCoordinates(-66391.0,2583.0,0.0))),
Line.ByStartPointEndPoint(Point.ByCoordinates(-66391.0,2583.0,0.0),(Point.ByCoordinates(-65266.0,3708.0,0.0))),
Line.ByStartPointEndPoint(Point.ByCoordinates(-66391.0,2583.0,0.0),(Point.ByCoordinates(-68017.0,4210.0,0.0))),
Line.ByStartPointEndPoint(Point.ByCoordinates(-68017.0,4210.0,0.0),(Point.ByCoordinates(-66892.0,5335.0,0.0))),
Line.ByStartPointEndPoint(Point.ByCoordinates(-60188.0,-1369.0,0.0),(Point.ByCoordinates(-60188.0,-1369.0,4500.0))),
Line.ByStartPointEndPoint(Point.ByCoordinates(-55688.0,-5869.0,0.0),(Point.ByCoordinates(-55688.0,-5869.0,4500.0))),
Line.ByStartPointEndPoint(Point.ByCoordinates(-62438.0,-10369.0,0.0),(Point.ByCoordinates(-62438.0,-10369.0,4500.0))),
Line.ByStartPointEndPoint(Point.ByCoordinates(-64688.0,-5869.0,0.0),(Point.ByCoordinates(-64688.0,-5869.0,4500.0))),
Line.ByStartPointEndPoint(Point.ByCoordinates(-60188.0,-5869.0,0.0),(Point.ByCoordinates(-60188.0,-5869.0,4500.0))),
Line.ByStartPointEndPoint(Point.ByCoordinates(-62438.0,-5869.0,0.0),(Point.ByCoordinates(-62438.0,-5869.0,4500.0))),
Line.ByStartPointEndPoint(Point.ByCoordinates(-64688.0,-10369.0,0.0),(Point.ByCoordinates(-64688.0,-10369.0,4500.0))),
Line.ByStartPointEndPoint(Point.ByCoordinates(-60188.0,-10369.0,0.0),(Point.ByCoordinates(-60188.0,-10369.0,4500.0))),
Line.ByStartPointEndPoint(Point.ByCoordinates(-55688.0,-1369.0,0.0),(Point.ByCoordinates(-55688.0,-1369.0,4500.0))),
Line.ByStartPointEndPoint(Point.ByCoordinates(-55688.0,-10369.0,0.0),(Point.ByCoordinates(-55688.0,-10369.0,4500.0))),
Line.ByStartPointEndPoint(Point.ByCoordinates(-65266.0,3708.0,0.0),(Point.ByCoordinates(-65266.0,3708.0,4500.0))),
Line.ByStartPointEndPoint(Point.ByCoordinates(-54490.0,4327.0,0.0),(Point.ByCoordinates(-54490.0,4327.0,4500.0))),
Line.ByStartPointEndPoint(Point.ByCoordinates(-52240.0,2077.0,0.0),(Point.ByCoordinates(-52240.0,2077.0,4500.0))),
Line.ByStartPointEndPoint(Point.ByCoordinates(-67516.0,1458.0,0.0),(Point.ByCoordinates(-67516.0,1458.0,4500.0))),
Line.ByStartPointEndPoint(Point.ByCoordinates(-66391.0,2583.0,0.0),(Point.ByCoordinates(-66391.0,2583.0,4500.0))),
Line.ByStartPointEndPoint(Point.ByCoordinates(-60188.0,2630.0,0.0),(Point.ByCoordinates(-60188.0,2630.0,4500.0))),
Line.ByStartPointEndPoint(Point.ByCoordinates(-63266.0,5708.0,0.0),(Point.ByCoordinates(-63266.0,5708.0,4500.0))),
Line.ByStartPointEndPoint(Point.ByCoordinates(-56490.0,6327.0,0.0),(Point.ByCoordinates(-56490.0,6327.0,4500.0))),
Line.ByStartPointEndPoint(Point.ByCoordinates(-69142.0,3085.0,0.0),(Point.ByCoordinates(-69142.0,3085.0,4500.0))),
Line.ByStartPointEndPoint(Point.ByCoordinates(-68017.0,4210.0,0.0),(Point.ByCoordinates(-68017.0,4210.0,4500.0))),
Line.ByStartPointEndPoint(Point.ByCoordinates(-64892.0,7335.0,0.0),(Point.ByCoordinates(-64892.0,7335.0,4500.0))),
Line.ByStartPointEndPoint(Point.ByCoordinates(-64688.0,-1369.0,0.0),(Point.ByCoordinates(-64688.0,-1369.0,4500.0))),
Line.ByStartPointEndPoint(Point.ByCoordinates(-66892.0,5335.0,0.0),(Point.ByCoordinates(-66892.0,5335.0,4500.0))),
Line.ByStartPointEndPoint(Point.ByCoordinates(-62438.0,-1369.0,0.0),(Point.ByCoordinates(-62438.0,-1369.0,4500.0))),
Line.ByStartPointEndPoint(Point.ByCoordinates(-62438.0, -10369.0, 4500), Point.ByCoordinates(-62438.0, -5869.0, 4500)),
Line.ByStartPointEndPoint(Point.ByCoordinates(-62438, -10369, 4500), Point.ByCoordinates(-60188,-10369,4500)),
Line.ByStartPointEndPoint(Point.ByCoordinates(-62438, -5869, 4500), Point.ByCoordinates(-60188,-5869,4500)),
Line.ByStartPointEndPoint(Point.ByCoordinates(-64688, -1369, 4500), Point.ByCoordinates(-62438, -1369,4500))];
# ----------------------------------------

code_block = CodeBlock { 4; }
code_block_2 = CodeBlock { 0.001; }
boolean = BoolSelector(true)
buildFromLines = TSpline.TSplineSurface.BuildFromLines(lines=lines_grid_set_2, maxFaceValence=code_block, snappingTolerance=code_block_2, inSmoothMode=boolean)

# group: Lines Grid - Set 1
byCoordinates = Point.ByCoordinates()
number_slider = DoubleSlider(5000, range=0..5000 step 0)
byCoordinates_2 = Point.ByCoordinates(y=number_slider)
number_slider_2 = DoubleSlider(9500, range=0..9500 step 500)
number_slider_3 = DoubleSlider(4500, range=0..4500 step 500)
byCoordinates_3 = Point.ByCoordinates(x=number_slider_2, y=number_slider_3)
number_slider_4 = DoubleSlider(3500, range=0..3500 step 500)
number_slider_5 = DoubleSlider(8000, range=0..8000 step 500)
byCoordinates_4 = Point.ByCoordinates(y=number_slider_4, z=number_slider_5)
number_slider_6 = DoubleSlider(7000, range=0..7000 step 500)
byCoordinates_5 = Point.ByCoordinates(z=number_slider_6)
number_slider_7 = DoubleSlider(8500, range=0..8500 step 500)
byCoordinates_6 = Point.ByCoordinates(x=number_slider_7)
code_block_3 = CodeBlock(point1=byCoordinates, point2=byCoordinates_2, point3=byCoordinates_3, point4=byCoordinates_4, point5=byCoordinates_5, point6=byCoordinates_6)
# ---------- code_block_3.designscript (11 lines) ----------
line1 = Line.ByStartPointEndPoint(point1, point2);
line2 = Line.ByStartPointEndPoint(point2, point3);
line3 = Line.ByStartPointEndPoint(point2, point4);
line4 = Line.ByStartPointEndPoint(point1, point5);
line5 = Line.ByStartPointEndPoint(point4, point5);
line6 = Line.ByStartPointEndPoint(point6, point1);
line7 = Line.ByStartPointEndPoint(point6, point1);
line8 = Line.ByStartPointEndPoint(point6, point3);
line9 = Line.ByStartPointEndPoint(point4, point3);
line10 = Line.ByStartPointEndPoint(point2, point1);
Line11 = Line.ByStartPointEndPoint(point5, point6);
# ----------------------------------------
join = List.Join(list0=code_block_3.line1, list1=code_block_3.line2, list2=code_block_3.line3, list3=code_block_3.Line11, list4=code_block_3.line5, list5=code_block_3.line6, list6=code_block_3.line7, list7=code_block_3.line8, list8=code_block_3.line9)

boolean_2 = BoolSelector(false)
boolean_3 = BoolSelector(true)
buildFromLines_2 = TSpline.TSplineSurface.BuildFromLines(lines=join, creaseOuterVertices=boolean_2, inSmoothMode=boolean_3)
