# Dynamo graph ZNPLCTHUSPIP3EMDAM4IGJTCBFMOVDXMVS2J4XSXYSX3WEWBWS5Q.dyn "CoordinateSystemAtSegmentLength" (Dynamo 2.0.1.5055)

code_block = CodeBlock { 6; }
randomList = Math.RandomList(amount=code_block)
code_block_2 = CodeBlock(x=randomList) { x*10; }
randomList_2 = Math.RandomList(amount=code_block)
code_block_3 = CodeBlock(x=randomList_2) { x*10; }
randomList_3 = Math.RandomList(amount=code_block)
code_block_4 = CodeBlock(x=randomList_3) { x*5; }
byCoordinates = Point.ByCoordinates(x=code_block_2, y=code_block_3, z=code_block_4)
byControlPoints = NurbsCurve.ByControlPoints(points=byCoordinates)
number_slider = DoubleSlider(14.55, range=0..30 step 0.01)  # graph input
coordinateSystemAtSegmentLength = Curve.CoordinateSystemAtSegmentLength(curve=byControlPoints, segmentLength=number_slider)
