# Dynamo graph Autodesk.DesignScript.Geometry.Point.Project.dyn "Project" (Dynamo 2.0.1.5055)

code_block = CodeBlock { -5; -1; 2; }
byCoordinates = Point.ByCoordinates(x=code_block.out0, y=code_block.out1, z=code_block.out2)
number_slider = DoubleSlider(2.6, range=0..10 step 0.1)  # graph input
byCenterPointRadius = Sphere.ByCenterPointRadius(radius=number_slider)
XAxis = Vector.XAxis()
project = Point.Project(point=byCoordinates, baseGeometry=byCenterPointRadius, projectionDirection=XAxis)
