# Dynamo graph Autodesk.DesignScript.Geometry.PolyCurve.Heal.dyn (Dynamo 2.19.0.5874)

code_block = CodeBlock()
# ---------- code_block.designscript (6 lines) ----------
a = Line.ByStartPointEndPoint(Point.ByCoordinates(0, 0, 0), Point.ByCoordinates(1000, 0, 0));
b = Line.ByStartPointEndPoint(Point.ByCoordinates(1000, 0, 0), Point.ByCoordinates(1000, 1000, 0));
c = Line.ByStartPointEndPoint(Point.ByCoordinates(1000, 1000, 0), Point.ByCoordinates(0, 1000, 0));
d = Line.ByStartPointEndPoint(Point.ByCoordinates(0, 1000, 0), Point.ByCoordinates(100, -100, 0));

t1 = [ a, b, c, d ];
# ----------------------------------------
code_block_2 = CodeBlock(t1=code_block.t1) { polyCurve1 = PolyCurve.ByJoinedCurves(t1, 0.001, false, 0); }
heal = PolyCurve.Heal(polyCurve=code_block_2)
points = PolyCurve.Points(polyCurve=heal)

# group: Visualize overlapping PolyCurve
code_block_3 = CodeBlock { Color.ByARGB(100,255,75,75); }
byGeometryColor = Modifiers.GeometryColor.ByGeometryColor(geometry=code_block_2, color=code_block_3)
