# Dynamo graph Autodesk.DesignScript.Geometry.Solid.Fillet.dyn "Fillet" (Dynamo 2.0.1.5055)

number_slider = DoubleSlider(6.041, range=0..100 step 0.1)
byCoordinates = Point.ByCoordinates(z=number_slider)
code_block = CodeBlock { 10; }
byLengths = Cuboid.ByLengths(origin=byCoordinates, width=code_block, length=code_block, height=code_block)
edges = Topology.Edges(topology=byLengths)
code_block_2 = CodeBlock { 0.5; }
fillet = Solid.Fillet(solid=byLengths, edges=edges, radius=code_block_2)
