# Dynamo graph Autodesk.DesignScript.Geometry.Surface.ByRevolve.dyn "ByRevolve" (Dynamo 2.0.1.5055)

code_block = CodeBlock { 0..360..36; }
cos = Math.Cos(angle=code_block)
code_block_2 = CodeBlock(x=cos) { x-2; }
code_block_3 = CodeBlock { 0..5..0.5; }
byCoordinates = Point.ByCoordinates(x=code_block_2, z=code_block_3)
byPoints = NurbsCurve.ByPoints(points=byCoordinates)
number_slider = DoubleSlider(66, range=0..360 step 1)  # graph input
number_slider_2 = DoubleSlider(239, range=0..360 step 1)  # graph input
byRevolve = Surface.ByRevolve(profile=byPoints, startAngle=number_slider, sweepAngle=number_slider_2)
