# Dynamo graph Autodesk.DesignScript.Geometry.CoordinateSystem.Mirror.dyn "Mirror" (Dynamo 2.0.1.5055)

code_block = CodeBlock { 2; 3; 1; }
byOrigin = CoordinateSystem.ByOrigin(x=code_block.out0, y=code_block.out1, z=code_block.out2)
YZ = Plane.YZ()
mirror = CoordinateSystem.Mirror(coordinateSystem=byOrigin, mirrorPlane=YZ)
watch = Watch(mirror)
