# Dynamo graph Autodesk.DesignScript.Geometry.Mesh.Vertices.dyn (Dynamo 2.6.1.8786)
# packages: MeshToolkit 3.0.0

file_path = Filename(".\stanford_bunny_tri.obj")
importFile = Mesh.ImportFile(fileName=file_path)
vertices = Mesh.Vertices(mesh=importFile)
