# Dynamo graph Autodesk.DesignScript.Geometry.TSpline.TSplineUVNFrame.U.dyn (Dynamo 2.19.0.6493)

code_block = CodeBlock { 70; 20; 15; }
byCoordinates = Point.ByCoordinates(x=code_block.out0, y=code_block.out1, z=code_block.out2)
code_block_2 = CodeBlock { 5; }
code_block_3 = CodeBlock { 5; }
code_block_4 = CodeBlock { 3; }
boolean = BoolSelector(true)
byBoxCorners = TSpline.TSplineSurface.ByBoxCorners(highPoint=byCoordinates, xSpans=code_block_2, ySpans=code_block_3, zSpans=code_block_4, inSmoothMode=boolean)
regularFaces = TSpline.TSplineTopology.RegularFaces(tSplineTopology=byBoxCorners)
UVNFrame = TSpline.TSplineFace.UVNFrame(tSplineFace=regularFaces)
position = TSpline.TSplineUVNFrame.Position(tSplineUVNFrame=UVNFrame)
U = TSpline.TSplineUVNFrame.U(tSplineUVNFrame=UVNFrame)
code_block_5 = CodeBlock { 5; }
byStartPointDirectionLength = Line.ByStartPointDirectionLength(startPoint=position, direction=U, length=code_block_5)
