# Dynamo graph Tessellation.ConvexHull.ByPoints.dyn "Tessellation.ConvexHull.ByPoints_img" (Dynamo 2.17.0.3255)

code_block = CodeBlock { 10; }
randomList = Math.RandomList(amount=code_block)
code_block_2 = CodeBlock(x=randomList) { x*5; }
code_block_3 = CodeBlock { 10; }
randomList_2 = Math.RandomList(amount=code_block_3)
code_block_4 = CodeBlock(x=randomList_2) { x*5; }
code_block_5 = CodeBlock { 10; }
randomList_3 = Math.RandomList(amount=code_block_5)
code_block_6 = CodeBlock(x=randomList_3) { x*5; }
byCoordinates = Point.ByCoordinates(x=code_block_2, y=code_block_4, z=code_block_6)
byPoints = Tessellation.ConvexHull.ByPoints(points=byCoordinates)
