# Dynamo graph Autodesk.DesignScript.Geometry.TSpline.TSplineSurface.ByBoxCorners.dyn (Dynamo 3.0.0.5795)

code_block = CodeBlock { 0; }
byCoordinates = Point.ByCoordinates(x=code_block, y=code_block, z=code_block)
code_block_2 = CodeBlock { 6; }
byCoordinates_2 = Point.ByCoordinates(x=code_block_2, y=code_block_2, z=code_block_2)
code_block_3 = CodeBlock { 2; 3; 4; }
boolean = BoolSelector(true)
boolean_2 = BoolSelector(true)
boolean_3 = BoolSelector(true)
byAxial = TSpline.TSplineInitialSymmetry.ByAxial(xAxis=boolean, yAxis=boolean_2, zAxis=boolean_3)
boolean_4 = BoolSelector(true)
byBoxCorners = TSpline.TSplineSurface.ByBoxCorners(lowPoint=byCoordinates, highPoint=byCoordinates_2, xSpans=code_block_3.out0, ySpans=code_block_3.out1, zSpans=code_block_3.out2, symmetry=byAxial, inSmoothMode=boolean_4)
