# Dynamo graph DSCore.List.Count.dyn (Dynamo 2.19.0.5742)

code_block = CodeBlock { 0..19..#11; }
byCoordinates = Point.ByCoordinates(x=code_block, y=code_block, lacing=CrossProduct)
flatten = List.Flatten(list=byCoordinates)
watch = Watch(flatten)
count = List.Count(list=watch)
watch_2 = Watch(count)
watch_3 = Watch(byCoordinates)
count_2 = List.Count(list=watch_3, lacing=Shortest)
watch_4 = Watch(count_2)
