# Dynamo graph E6WVV65M7FG2AAAGG4DXIQJPDKVNYXI5GRVNBAR4TR6T6356R2TQ.dyn "Autodesk.DesignScript.Geometry.TSpline.TSplineSurface.ByQuadballCenterRadius" (Dynamo 2.19.3.6543)

code_block = CodeBlock { -4; 4; }
byCoordinates = Point.ByCoordinates(x=code_block.out0, y=code_block.out0, z=code_block.out1)
code_block_2 = CodeBlock { 4; 2; }
boolean = BoolSelector(false)
boolean_2 = BoolSelector(false)
boolean_3 = BoolSelector(true)
byAxial = TSpline.TSplineInitialSymmetry.ByAxial(xAxis=boolean, yAxis=boolean_2, zAxis=boolean_3)
boolean_4 = BoolSelector(true)
byQuadballCenterRadius = TSpline.TSplineSurface.ByQuadballCenterRadius(center=byCoordinates, radius=code_block_2.out0, spans=code_block_2.out1, symmetry=byAxial, inSmoothMode=boolean_4)
