# Dynamo graph QMBSK3FVRYFQCMSXFIPKLNLYVY5W4C4PNN7IGZUPDZOVWUPWZNZQ.dyn "Autodesk.DesignScript.Geometry.TSpline.TSplineSurface.ByPlaneBestFitThroughPoints(random points)" (Dynamo 2.19.0.6493)

code_block = CodeBlock { 27; }
randomList = Math.RandomList(amount=code_block)
code_block_2 = CodeBlock { 25; }
remapRange = Math.RemapRange(numbers=randomList, newMax=code_block_2)
code_block_3 = CodeBlock { 3; }
chop = List.Chop(list=remapRange, lengths=code_block_3)
transpose = List.Transpose(lists=chop)
code_block_4 = CodeBlock(x=transpose) { x[0]; x[1]; x[2]; }
byCoordinates = Point.ByCoordinates(x=code_block_4.out0, y=code_block_4.out1, z=code_block_4.out2)
byCoordinates_2 = Point.ByCoordinates()
number_slider = DoubleSlider(47.353, range=-29.231..100 step 0.1)
number_slider_2 = DoubleSlider(38.828, range=-25.078..100 step 0.1)
byCoordinates_3 = Point.ByCoordinates(x=number_slider, y=number_slider_2)
code_block_5 = CodeBlock { 10; 5; }
boolean = BoolSelector(true)
boolean_2 = BoolSelector(false)
boolean_3 = BoolSelector(false)
byAxial = TSpline.TSplineInitialSymmetry.ByAxial(xAxis=boolean, yAxis=boolean_2, zAxis=boolean_3)
boolean_4 = BoolSelector(true)
byPlaneBestFitThroughPoints = TSpline.TSplineSurface.ByPlaneBestFitThroughPoints(points=byCoordinates, minCorner=byCoordinates_2, maxCorner=byCoordinates_3, xSpans=code_block_5.out0, ySpans=code_block_5.out1, symmetry=byAxial, inSmoothMode=boolean_4)
