# Dynamo graph USR6ESCX7ACJGZV2YVVIIF7437ZNDU23SUQ6IAHAIPM2YY2FPFGA.dyn "Autodesk.DesignScript.Geometry.TSpline.TSplineSurface.Thicken" (Dynamo 2.13.1.3887)

code_block = CodeBlock()
# ---------- code_block.designscript (8 lines) ----------
point1 = Point.ByCoordinates(0, 0, 0);
point2 = Point.ByCoordinates(0, 5, 0);
point3 = Point.ByCoordinates(5, 5, 0);
point4 = Point.ByCoordinates(5, 0, 0);
point5 = Point.ByCoordinates(10, 0, 0);
point6 = Point.ByCoordinates(10, 5, 0);
point7 = Point.ByCoordinates(15, 5, 0);
point8 = Point.ByCoordinates(15, 0, 0);
# ----------------------------------------
list_create = List.Create(item0=code_block.point1, item1=code_block.point2, item2=code_block.point3, item3=code_block.point4, item4=code_block.point5, item5=code_block.point6, item6=code_block.point7, item7=code_block.point8)
code_block_2 = CodeBlock { 4; }
byControlPoints = NurbsCurve.ByControlPoints(points=list_create, degree=code_block_2)
ZAxis = Vector.ZAxis()
code_block_3 = CodeBlock { 4; 2; 8; }
boolean = BoolSelector(true)
byExtrude = TSpline.TSplineSurface.ByExtrude(curve=byControlPoints, direction=ZAxis, frontDistance=code_block_3.out0, frontSpans=code_block_3.out1, profileSpans=code_block_3.out2, inSmoothMode=boolean)
code_block_4 = CodeBlock { 2; }
byCoordinates = Vector.ByCoordinates(y=code_block_4)
thicken = TSpline.TSplineSurface.Thicken(tSplineSurface=byExtrude, vector=byCoordinates)
XAxis = Vector.XAxis()
code_block_5 = CodeBlock { 20; }
translate = Geometry.Translate(geometry=thicken, direction=XAxis, distance=code_block_5)
