# Dynamo graph Autodesk.DesignScript.Geometry.Edge.AdjacentFaces.dyn "AdjacentFaces" (Dynamo 2.17.0.2366)

code_block = CodeBlock { 5; }
byCenterPointRadius = Circle.ByCenterPointRadius(radius=code_block)
code_block_2 = CodeBlock { 6; }
regularPolygon = Polygon.RegularPolygon(circle=byCenterPointRadius, numberSides=code_block_2)
code_block_3 = CodeBlock { 3; }
extrudeAsSolid = Curve.ExtrudeAsSolid(curve=regularPolygon, distance=code_block_3)
code_block_4 = CodeBlock(geometry=extrudeAsSolid) { color = Color.ByARGB(100,141,198,217); GeometryColor.ByGeometryColor(geometry, color); }
edges = Topology.Edges(topology=extrudeAsSolid)
code_block_5 = CodeBlock { 4; }
getItemAtIndex = List.GetItemAtIndex(list=edges, index=code_block_5)
adjacentFaces = Edge.AdjacentFaces(edge=getItemAtIndex)
surfaceGeometry = Face.SurfaceGeometry(face=adjacentFaces)
watch = Watch(adjacentFaces)
