# Dynamo graph Autodesk.DesignScript.Geometry.Mesh.MakeHollow.dyn (Dynamo 2.6.1.8786)
# packages: MeshToolkit 3.0.0

code_block = CodeBlock { 20; 40; }
code_block_2 = CodeBlock { 50; 100; }
boolean = BoolSelector(true)
cone = Mesh.Cone(baseRadius=code_block.out1, topRadius=code_block.out0, height=code_block_2.out0, divisions=code_block_2.out1, cap=boolean)
code_block_3 = CodeBlock { 5; }
code_block_4 = CodeBlock { 2; }
code_block_5 = CodeBlock { 1; }
code_block_6 = CodeBlock { 16; }
makeHollow = Mesh.MakeHollow(mesh=cone, holeCount=code_block_3, holeRadius=code_block_4, wallThickness=code_block_5, solidResolution=code_block_6, meshResolution=code_block_6)
edges = Mesh.Edges(mesh=makeHollow)
