# Dynamo graph Autodesk.DesignScript.Geometry.Rectangle.ByCornerPoints(points).dyn "ByCornerPoints" (Dynamo 2.0.1.5055)

number_slider = DoubleSlider(1.4, range=1..10 step 0.1)  # graph input
number_slider_2 = DoubleSlider(4.1, range=1..10 step 0.1)  # graph input
code_block = CodeBlock(x=number_slider, y=number_slider_2) { x; y; }
byCoordinates = Point.ByCoordinates(x=code_block.y, y=code_block.y)
byCoordinates_2 = Point.ByCoordinates(x=code_block.y, y=code_block.x)
byCoordinates_3 = Point.ByCoordinates(x=code_block.x, y=code_block.x)
byCoordinates_4 = Point.ByCoordinates(x=code_block.x, y=code_block.y)
byCornerPoints = Rectangle.ByCornerPoints(p1=byCoordinates, p2=byCoordinates_2, p3=byCoordinates_3, p4=byCoordinates_4)
join = List.Join(list0=byCoordinates, list1=byCoordinates_2, list2=byCoordinates_3, list3=byCoordinates_4)
byCornerPoints_2 = Rectangle.ByCornerPoints(points=join)
