# Dynamo graph Autodesk.DesignScript.Geometry.TSpline.TSplineEdge.Index.dyn (Dynamo 2.19.0.6493)

code_block = CodeBlock { 15; 5; 8; }
boolean = BoolSelector(true)
byBoxLengths = TSpline.TSplineSurface.ByBoxLengths(width=code_block.out2, length=code_block.out0, height=code_block.out1, ySpans=code_block.out1, inSmoothMode=boolean)
integer_slider = IntegerSlider(29, range=0..47 step 1)
faceByIndex = TSpline.TSplineTopology.FaceByIndex(tSplineTopology=byBoxLengths, index=integer_slider)
deleteFaces = TSpline.TSplineSurface.DeleteFaces(tSplineSurface=byBoxLengths, faces=faceByIndex)
decomposedEdges = TSpline.TSplineTopology.DecomposedEdges(tSplineTopology=deleteFaces)
index = TSpline.TSplineEdge.Index(tSplineEdge=decomposedEdges.border)
watch = Watch(index)
