# Dynamo graph Autodesk.DesignScript.Geometry.Vector.Y.dyn "Y" (Dynamo 2.0.1.5055)

code_block = CodeBlock { Point.ByCoordinates(0,2,0); Vector.ByCoordinates(4,2,3); }
vector_scale = DoubleSlider(1.47, range=1..2 step 0.01)  # graph input
scale = Vector.Scale(vector=code_block.out1, scale_factor=vector_scale)
length = Vector.Length(vector=scale)
byStartPointDirectionLength = Line.ByStartPointDirectionLength(startPoint=code_block.out0, direction=code_block.out1, length=length)
Y = Vector.Y(vector=code_block.out1)
watch = Watch(Y)
Y_2 = Vector.Y(vector=scale)
watch_2 = Watch(Y_2)
