# Dynamo graph DSCore.IO.Image.WriteToFile.dyn "DSCore.IO.Image.WriteToFile_img" (Dynamo 2.17.0.3255)

file_path = Filename("..\..\..\..\..\..\..\..\..\..\Temp\sample.png")
code_block = CodeBlock { 0..255..1; }
byARGB = Color.ByARGB(red=code_block, green=code_block, lacing=CrossProduct)
fromPixels = Image.FromPixels(colors=byARGB)
writeToFile = Image.WriteToFile(path=file_path, image=fromPixels)
