# Dynamo graph DSCore.Math.RemapRange.dyn (Dynamo 1.0.0.1180)

integer_slider = IntegerSlider(7, range=0..10 step 1)
randomList = Math.RandomList(integer_slider)
integer_slider_2 = IntegerSlider(12, range=0..100 step 1)
integer_slider_3 = IntegerSlider(46, range=0..100 step 1)
remapRange = Math.RemapRange(numbers=randomList, newMin=integer_slider_2, newMax=integer_slider_3)
watch = Watch(remapRange)
