# Dynamo graph G4FMYWTHURTGUOQQGRPIN6WMHT2BRYZXFVAJBYAUIIJQUAKWSY3Q.dyn "Autodesk.DesignScript.Geometry.CoordinateSystem.Translate(direction, distance)" (Dynamo 2.17.0.3255)

byOrigin = CoordinateSystem.ByOrigin()
number_slider = DoubleSlider(3.1, range=0..5 step 0.1)  # graph input
number_slider_2 = DoubleSlider(4.1, range=0..5 step 0.1)  # graph input
byCoordinates = Vector.ByCoordinates(x=number_slider, y=number_slider_2)
number_slider_3 = DoubleSlider(3, range=0..4 step 0.1)  # graph input
translate = CoordinateSystem.Translate(coordinateSystem=byOrigin, direction=byCoordinates, distance=number_slider_3)
byRadiusHeight = Cylinder.ByRadiusHeight(coordinateSystem=translate)
code_block = CodeBlock(geometry=byRadiusHeight) { color = Color.ByARGB(100,141,198,217); Modifiers.GeometryColor.ByGeometryColor(geometry, color); }
