# Dynamo graph Autodesk.DesignScript.Geometry.Curve.ByParameterLineOnSurface.dyn "ByParameterLineOnSurface" (Dynamo 2.0.1.5055)

code_block = CodeBlock { 0..25..#5; }
byCoordinates = Point.ByCoordinates(x=code_block, y=code_block, lacing=CrossProduct)
asVector = Point.AsVector(point=byCoordinates)
length = Vector.Length(vector=asVector)
random = Math.Random(seed=length)
translate = Geometry.Translate(geometry=byCoordinates, zTranslation=random)
byPoints = NurbsSurface.ByPoints(points=translate)
number_slider = DoubleSlider(0.37, range=0..1 step 0.01)  # graph input
number_slider_2 = DoubleSlider(0.37, range=0..1 step 0.01)  # graph input
byCoordinates_2 = UV.ByCoordinates(u=number_slider, v=number_slider_2)
number_slider_3 = DoubleSlider(0.62, range=0..1 step 0.01)  # graph input
number_slider_4 = DoubleSlider(0.75, range=0..1 step 0.01)  # graph input
byCoordinates_3 = UV.ByCoordinates(u=number_slider_3, v=number_slider_4)
byParameterLineOnSurface = Curve.ByParameterLineOnSurface(baseSurface=byPoints, startParams=byCoordinates_2, endParams=byCoordinates_3)
