# Dynamo graph CoreNodeModels.Equals.dyn "CoreNodeModels.Equals_img" (Dynamo 2.17.0.3255)

integer_slider = IntegerSlider(1, range=0..100 step 1)
integer_slider_2 = IntegerSlider(25, range=0..100 step 1)
eq = integer_slider == integer_slider_2
watch = Watch(eq)
