# Dynamo graph DSCore.Color.Multiply.dyn "Multiply" (Dynamo 2.0.1.5055)

byLengths = Cuboid.ByLengths()
number_slider = DoubleSlider(116, range=0..255 step 1)  # graph input
number_slider_2 = DoubleSlider(80, range=0..255 step 1)  # graph input
byARGB = Color.ByARGB(a=number_slider, r=number_slider_2)
number_slider_3 = DoubleSlider(2, range=0..10 step 0.1)  # graph input
multiply = Color.Multiply(c1=byARGB, div=number_slider_3)
byGeometryColor = Modifiers.GeometryColor.ByGeometryColor(geometry=byLengths, color=multiply)
