# Dynamo graph DSCore.Object.Type.dyn "Type" (Dynamo 2.0.1.5055)

code_block = CodeBlock { 1; }
type = Object.Type(obj=code_block)
watch = Watch(type)
code_block_2 = CodeBlock { Point.ByCoordinates(-2,0); }
byCenterPointRadius = Circle.ByCenterPointRadius(centerPoint=code_block_2)
type_2 = Object.Type(obj=byCenterPointRadius)
watch_2 = Watch(type_2)
origin = Point.Origin()
type_3 = Object.Type(obj=origin)
watch_3 = Watch(type_3)
code_block_3 = CodeBlock { 1..4..0.5; }
byCoordinates = Point.ByCoordinates(x=code_block_3, y=code_block_3, lacing=CrossProduct)
ZAxis = Vector.ZAxis()
code_block_4 = CodeBlock { 0..2..0.2; }
code_block_5 = CodeBlock { 0.3; }
mod = code_block_4 % code_block_5
translate = Geometry.Translate(geometry=byCoordinates, direction=ZAxis, distance=mod)
byControlPoints = NurbsSurface.ByControlPoints(controlVertices=translate)
type_4 = Object.Type(obj=byControlPoints)
watch_4 = Watch(type_4)
code_block_6 = CodeBlock { "a string"; }
type_5 = Object.Type(obj=code_block_6)
watch_5 = Watch(type_5)
