# Dynamo graph 4HVWIMWUUU4ZQWQXKFRWMQ5JABJVFMYBXFJZTHB2CQKCRQQ2FDVQ.dyn "Translate" (Dynamo 2.0.1.5055)

code_block = CodeBlock { 8; 2; 5; }
byCoordinates = Point.ByCoordinates(x=code_block.out0, y=code_block.out1, z=code_block.out2)
code_block_2 = CodeBlock { 5; 2; 8; }
byCoordinates_2 = Point.ByCoordinates(x=code_block_2.out0, y=code_block_2.out1, z=code_block_2.out2)
byPointsRadius = Cone.ByPointsRadius(startPoint=byCoordinates, endPoint=byCoordinates_2, startRadius=code_block_2.out0)
byTwoPoints = Vector.ByTwoPoints(start=byCoordinates, end=byCoordinates_2)
translate = Geometry.Translate(geometry=byPointsRadius, direction=byTwoPoints)
