# Dynamo graph Autodesk.DesignScript.Geometry.CoordinateSystem.Origin.dyn "Origin" (Dynamo 2.0.1.5055)

code_block = CodeBlock { 4; }
number_slider = DoubleSlider(172.1, range=0..359 step 0.1)  # graph input
number_slider_2 = DoubleSlider(240.1, range=0..359 step 0.1)  # graph input
code_block_2 = CodeBlock(theta=number_slider, phi=number_slider_2) { 0..theta..#20; 0..phi..#20; }
bySphericalCoordinates = CoordinateSystem.BySphericalCoordinates(radius=code_block, theta=code_block_2.out0, phi=code_block_2.out1)
origin = CoordinateSystem.Origin(coordinateSystem=bySphericalCoordinates)
