# Dynamo graph Autodesk.DesignScript.Geometry.TSpline.TSplineSurface.UncreaseEdges.dyn "Autodesk.DesignScript.Geometry.TSpline.TSplineSurface.UncreaswEdges" (Dynamo 2.19.3.6543)

code_block = CodeBlock { 5; 10; }
code_block_2 = CodeBlock { 5; 8; }
boolean = BoolSelector(true)
byTorusCenterRadii = TSpline.TSplineSurface.ByTorusCenterRadii(innerRadius=code_block.out0, outerRadius=code_block.out1, innerRadiusSpans=code_block_2.out0, outerRadiusSpans=code_block_2.out1, inSmoothMode=boolean)
edgesCount = TSpline.TSplineTopology.EdgesCount(tSplineTopology=byTorusCenterRadii)
code_block_3 = CodeBlock(n=edgesCount) { [0..n-1]; }
edgeByIndex = TSpline.TSplineTopology.EdgeByIndex(tSplineTopology=byTorusCenterRadii, index=code_block_3)
creaseEdges = TSpline.TSplineSurface.CreaseEdges(tSplineSurface=byTorusCenterRadii, edges=edgeByIndex)
code_block_4 = CodeBlock { [0..7]; }
edgeByIndex_2 = TSpline.TSplineTopology.EdgeByIndex(tSplineTopology=creaseEdges, index=code_block_4)
uncreaseEdges = TSpline.TSplineSurface.UncreaseEdges(tSplineSurface=creaseEdges, edges=edgeByIndex_2)
UVNFrame = TSpline.TSplineEdge.UVNFrame(tSplineEdge=edgeByIndex_2)
position = TSpline.TSplineUVNFrame.Position(tSplineUVNFrame=UVNFrame)
