# Dynamo graph create point - end.dyn

number = DoubleInput(0, lacing=Longest)
number_2 = DoubleInput(0, lacing=Longest)
number_slider = DoubleSliderInput(0, range=0..100, lacing=Longest)
XYZ = XYZ(number, number_2, number_slider, lacing=Longest)
ref_point = ReferencePointByXYZ(XYZ, lacing=Longest)
