# Dynamo graph create point_sequence.dyn

number = DoubleInput(0)
number_slider = DoubleSliderInput(82.22222222, range=0..100)
number_2 = DoubleInput(10)
number_sequence = BuildSeq(number, number_slider, number_2)
# note: Set Lacing to "Longest"
XYZ = XYZ(number, number, number_sequence, lacing=Longest)
reference_point = ReferencePointByXYZ(XYZ, lacing=Longest)
number_3 = DoubleInput(0)
number_4 = DoubleInput(0)
number_5 = DoubleInput(0)
