# Dynamo graph divide selected curve - end.dyn (Dynamo 0.6.2.14024)

number = DoubleInput(21)
select_curve = CurvesBySelection()
number_slider = DoubleSliderInput(33.333, range=0..100)
xyz_array_on_curve = XyzArrayAlongCurve(select_curve, number_slider)
ref_point = ReferencePointByXyz(xyz_array_on_curve, lacing=Longest)
