# Dynamo graph divide selected curve.dyn (Dynamo 0.6.2.14024)

select_curve = CurvesBySelection()
number = DoubleInput(21)
xyz_array_on_curve = XyzArrayAlongCurve(select_curve, number)
ref_point = ReferencePointByXyz(xyz_array_on_curve, lacing=Longest)
