# Dynamo graph form from curve selection - list.dyn

boolean = BoolSelector(true)
curves_by_selection = CurvesBySelection()  # 1 picked in the model
curve_reference = CurveRef(curves_by_selection)
list = NewList(item_s=curve_reference)
curves_by_selection_2 = CurvesBySelection()  # 1 picked in the model
curve_reference_2 = CurveRef(curves_by_selection_2)
list_2 = NewList(item_s=curve_reference_2)
list_3 = NewList(item_s=list, index1=list_2)
boolean_2 = BoolSelector(true)
loft_form = LoftForm(boolean, list_3, boolean_2)
