# Dynamo graph form from curve selection.dyn (Dynamo 0.6.2.14024)

boolean = BoolSelector(false)
select_curve = CurvesBySelection()
select_curve_2 = CurvesBySelection()
list = NewList(index0=select_curve, index1=select_curve_2)
loft_surface = LoftForm(arg1=list, FormId=33210, PreferSurfaceForOneLoop=true, FormCurveToReferenceCurveMap="32741=33210;32722=33210;", lacing=Longest)
