# Dynamo graph OLDscalable graph function.dyn

number_slider = DoubleSliderInput(39.56928839, range=0..50)
π = Pi()
formula = Formula("x*-pi", number_slider, π)
multiplication = Multiplication(π, number_slider)
number = DoubleInput(32)
formula_2 = Formula("x*(pi/y)", number_slider, π, number)
number_slider_2 = DoubleSliderInput(1.111111111, range=0..10)
multiplication_2 = Multiplication(number_slider, number_slider_2)
sine = Sin()
formula_3 = Formula("1/x", x=number_slider)
formula_4 = Formula("C*f(d*x)", C=multiplication_2, d=sine, x=formula_3)
graphFunction = Custom[GraphFunction](x_start=formula, x_end=multiplication, x_step=formula_2, y=formula_4)
reference_point = ReferencePointByXYZ(graphFunction, lacing=Longest)
connectPoints = Custom[ConnectPoints](refPts=reference_point)
