# Dynamo graph connect two point arrays without python.dyn (Dynamo 0.6.2.14024)

list = NewList()
select_curve = CurvesBySelection()  # 1 picked in the model
number_slider = DoubleSliderInput(15.23814286, range=0..20)
xyz_array_on_curve = XyzArrayAlongCurve(select_curve, number_slider, lacing=Longest)
reference_point = ReferencePointByXyz(xyz_array_on_curve, lacing=Longest)
select_curve_2 = CurvesBySelection()  # 1 picked in the model
xyz_array_on_curve_2 = XyzArrayAlongCurve(select_curve_2, number_slider, lacing=Longest)
reference_point_2 = ReferencePointByXyz(xyz_array_on_curve_2, lacing=Longest)
combine = Combine(list, reference_point, reference_point_2)
boolean = BoolSelector(true)
curve_by_points = CurveByPoints(combine, boolean, lacing=Longest)
