# Dynamo graph connect two point arrays.dyn (Dynamo 0.6.2.14024)

select_curve = CurvesBySelection()  # 1 picked in the model
number_slider = DoubleSliderInput(18.26, range=0..20)
xyz_array_on_curve = XyzArrayAlongCurve(select_curve, number_slider, lacing=Longest)
reference_point = ReferencePointByXyz(xyz_array_on_curve, lacing=Longest)
select_curve_2 = CurvesBySelection()  # 1 picked in the model
xyz_array_on_curve_2 = XyzArrayAlongCurve(select_curve_2, number_slider, lacing=Longest)
reference_point_2 = ReferencePointByXyz(xyz_array_on_curve_2, lacing=Longest)
list = NewList(index0=reference_point, index1=reference_point_2, index2=number_slider)
watch = Watch(list)
python_script = Python(list)
# ---------- python_script.python (36 lines) ----------
# Default imports
import clr
clr.AddReference('RevitAPI')
clr.AddReference('RevitAPIUI')
from Autodesk.Revit.DB import *
import Autodesk
import sys
import clr
path = r'C:\Autodesk\Dynamo\Core'
exec_path = r'C:\Users\Ian\Documents\GitHub\Dynamo\bin\AnyCPU\Debug'
sys.path.append(path)
sys.path.append(exec_path)
clr.AddReference('LibGNet')
from Autodesk.LibG import *
import math

doc = __revit__.ActiveUIDocument.Document
app = __revit__.Application

RefPointList1 = IN[0]
RefPointList2 = IN[1]
count = IN[2] 

max = int(count)

#use for loop to connect two series of points
#if count > len(RefPointList1):
max = len(RefPointList1)

for i in range(0,max):
    pt1 = RefPointList1[i]
    pt2 = RefPointList2[i]
    refptarr = ReferencePointArray()
    refptarr.Append(pt1)
    refptarr.Append(pt2)
    crv = doc.FamilyCreate.NewCurveByPoints(refptarr)
# ----------------------------------------
