# Dynamo graph create sine wave from selected points.dyn (Dynamo 0.6.2.14024)

select_reference_point = PointBySelection()  # 1 picked in the model
# note: Select two points.
# note: Create a list.
select_reference_point_2 = PointBySelection()  # 1 picked in the model
list = NewList(index0=select_reference_point, index1=select_reference_point_2)
# note: Make a python script.
python_script = Python(list)
# ---------- python_script.python (62 lines) ----------
#derived from Nathan Miller's example http://theprovingground.wikidot.com/revit-api-py-curves

# Default imports
import clr
clr.AddReference('RevitAPI')
clr.AddReference('RevitAPIUI')
from Autodesk.Revit.DB import *
import Autodesk
import sys
import clr
path = r'C:\Autodesk\Dynamo\Core'
exec_path = r'C:\Users\Ian\Documents\GitHub\Dynamo\bin\AnyCPU\Debug'
sys.path.append(path)
sys.path.append(exec_path)
clr.AddReference('LibGNet')
from Autodesk.LibG import *
import math

doc = __revit__.ActiveUIDocument.Document
app = __revit__.Application

# get the input points
beginPoint = IN[0]
endPoint = IN[1]

# The __persistent__ dictionary gives you a persistent
# dictionary between runs.  Here we use it to store elements
# we wish to clean up later.

# Initialize if it's not already created.
if 'oldElements' not in __persistent__:
	__persistent__['oldElements'] = []

#delete old elements
if __persistent__['oldElements'].Count > 0:
     count = 0
     for eID in __persistent__['oldElements']:
          doc.Delete( __persistent__['oldElements'][count] )
          count = count + 1

# Clear the dictionary as we've deleted those old elements
__persistent__['oldElements'] = []

lineRefPointArray = ReferencePointArray()
lineRefPointArray.Append(beginPoint)
lineRefPointArray.Append(endPoint)

crv = doc.FamilyCreate.NewCurveByPoints(lineRefPointArray)
crvRef = crv.GeometryCurve
refptarr = ReferencePointArray()

#use for loop to create a series of points
steps = 20
for i in range(0,steps+1):
    pt = crvRef.Evaluate(float(i)/steps,1) # returns and XYZ
    x = pt.X
    y = pt.Y
    z = pt.Z + math.sin(i)*steps 
    myXYZ = XYZ(x,y,z)
    refPt = doc.FamilyCreate.NewReferencePoint(myXYZ)
    __persistent__['oldElements'].Add(refPt.Id)
    refptarr.Append(refPt)
# ----------------------------------------
# note: Create a transaction to wrap the python script.
transaction = Transaction(python_script)
watch = Watch(python_script)
