# Dynamo graph solar radiation optimizer.dyn (Dynamo 0.6.2.14024)

select_family_instance = FamilyInstanceCreatorSelection()  # 1 picked in the model
string = StringInput("increment")
number = DoubleInput(1)
number_2 = DoubleInput(36)
filename = StringFilename("C:\Dynamo\solar.csv")
solar_radiation_optimizer = Custom[Solar Radiation Optimizer](famInst=select_family_instance, parameter=string, increment=number, max=number_2, path=filename)
