# Dynamo graph inst param 2 masses driving each other.dyn

select_family_instance = FamilyInstanceCreatorSelection()  # 1 picked in the model
select_fam_inst_param = FamilyInstanceParameterSelector(select_family_instance)
get_instance_parameter = FamilyInstanceParameterGetter(select_family_instance, select_fam_inst_param, lacing=Longest)
watch = Watch(get_instance_parameter)
select_family_instance_2 = FamilyInstanceCreatorSelection()  # 1 picked in the model
set_instance_parameter = FamilyInstanceParameterSetter(select_family_instance_2, select_fam_inst_param, get_instance_parameter, lacing=Longest)
