# Dynamo graph inst param 2 masses.dyn (Dynamo 0.6.2.14024)

select_family_instance = FamilyInstanceCreatorSelection()  # 1 picked in the model
select_family_instance_2 = FamilyInstanceCreatorSelection()  # 1 picked in the model
get_family_parameter = FamilyInstanceParameterSelector(select_family_instance_2)
number_slider = DoubleSliderInput(40, range=0..100)
set_family_instance_parameter = FamilyInstanceParameterSetter(select_family_instance, get_family_parameter, number_slider, lacing=Longest)
set_family_instance_parameter_2 = FamilyInstanceParameterSetter(select_family_instance_2, get_family_parameter, number_slider, lacing=Longest)
get_family_instance_parameter = FamilyInstanceParameterGetter(set_family_instance_parameter_2, get_family_parameter, lacing=Longest)  # "Get Family Instance Parameter Value"
watch = Watch(get_family_instance_parameter)
