# Dynamo graph inst param end.dyn

family_instance_by_selection = FamilyInstanceCreatorSelection()  # 1 picked in the model
select_fam_inst_param = FamilyInstanceParameterSelector(family_instance_by_selection)
number_slider = DoubleSliderInput(0.3, range=0..1)
set_instance_parameter = FamilyInstanceParameterSetter(family_instance_by_selection, select_fam_inst_param, number_slider, lacing=Longest)
get_instance_parameter = FamilyInstanceParameterGetter(set_instance_parameter, select_fam_inst_param, lacing=Longest)
watch = Watch(get_instance_parameter)
