# Dynamo graph inst param.dyn

family_instance_by_selection = FamilyInstanceCreatorSelection()  # 1 picked in the model
select_fam_inst_param = FamilyInstanceParameterSelector(family_instance_by_selection)
get_instance_parameter = FamilyInstanceParameterGetter(family_instance_by_selection, select_fam_inst_param, lacing=Longest)
watch = Watch(get_instance_parameter)
