# Dynamo graph DynamicMobius.dyn (Dynamo 0.7.0.21950)

file_path = Filename("C:\Users\t_ellis\Documents\GitHub\Dynamo\doc\distrib\Samples\09 Dynamic Python Editing\mobius.py")
readText = File.ReadText(file_path)
double_slider = DoubleSlider(0.5, range=0..3)
python_script_from_string = PythonStringNode(script=readText, IN[0]=double_slider)
