# Dynamo graph Attractor Logic_Start.dyn

number = DoubleInput(15)
number_2 = DoubleInput(1)
number_3 = DoubleInput(0)
number_4 = DoubleInput(2)
# note: XYZ Point Grid
xyz_grid = ReferencePtGrid(number, number, number_2, number_3, number_3, number_3, number_4, number_4, number_4, lacing=Longest)
number_slider = DoubleSliderInput(0.9385927505, range=0.1..2)
# note: Circle with variable radii
circle = Circle(xyz_grid, number_slider, lacing=Longest)
watch_3d = Watch3D(circle)
# note: Create a distance-based
# relationship with a single point.
xyz_distance = XYZDistance(lacing=Longest)
number_5 = DoubleInput(30)
divide = Division(arg1=number_5, lacing=Longest)
number_slider_2 = DoubleSliderInput(25.97014925, range=0..30)
number_slider_3 = DoubleSliderInput(19.92537313, range=0..30)
number_6 = DoubleInput(0)
# note: 'Attractor' Point
XYZ = XYZ(number_slider_2, number_slider_3, number_6, lacing=Longest)
watch = Watch(XYZ)
new_sketch_plane = Custom[New Sketch Plane]()
# note: Make Revit Stuff
reference_curve = ReferenceCurve(arg1=new_sketch_plane, lacing=Longest)
