# Dynamo graph tower 2.dyn
# Copyright Autodesk, Inc. 2012. All rights reserved.
# Licensed under the Apache License, Version 2.0 (the "License");
# you may not use this file except in compliance with the License.
# You may obtain a copy of the License at
# http://www.apache.org/licenses/LICENSE-2.0
# Unless required by applicable law or agreed to in writing, software
# distributed under the License is distributed on an "AS IS" BASIS,
# WITHOUT WARRANTIES OR CONDITIONS OF ANY KIND, either express or implied.
# See the License for the specific language governing permissions and
# limitations under the License.

number_slider = DoubleSliderInput(500, range=0..500)
# note: top
level = Level(number_slider)
number_slider_2 = DoubleSliderInput(100, range=0..100)
level_2 = Level(number_slider_2)
# note: Base
number = DoubleInput(0)
# note: a
level_3 = Level(number)
# note: Mid
# note: Lower Floor To Floor
number_slider_3 = DoubleSliderInput(10, range=0..10)
boolean = BoolSelector(false)
array = Function(number, number_slider_2, number_slider_3, boolean)
watch = Watch(array)
level_4 = Level(array)
number_slider_4 = DoubleSliderInput(15, range=0..15)
build_sequence = BuildSeq(number_slider_2, number_slider, number_slider_4)
level_5 = Level(build_sequence)
