# Dynamo graph tower 3.dyn
# Copyright Autodesk, Inc. 2012. All rights reserved.
# Licensed under the Apache License, Version 2.0 (the "License");
# you may not use this file except in compliance with the License.
# You may obtain a copy of the License at
# http://www.apache.org/licenses/LICENSE-2.0
# Unless required by applicable law or agreed to in writing, software
# distributed under the License is distributed on an "AS IS" BASIS,
# WITHOUT WARRANTIES OR CONDITIONS OF ANY KIND, either express or implied.
# See the License for the specific language governing permissions and
# limitations under the License.

number_slider = DoubleSliderInput(600, range=0..600)
# note: top
level = Level(number_slider)
number_slider_2 = DoubleSliderInput(100, range=0..100)
level_2 = Level(number_slider_2)
# note: Base
number = DoubleInput(0)
# note: Mid
# note: Lower Floor To Floor
number_slider_3 = DoubleSliderInput(20, range=0..20)
boolean = BoolSelector(true)
array = Function(number, number_slider_2, number_slider_3, boolean)
watch = Watch(array)
level_3 = Level(array)
build_sequence = BuildSeq()
number_slider_4 = DoubleSliderInput(10, range=0..10)
array_2 = Function(number_slider_2, number_slider, number_slider_4, boolean)
level_4 = Level(array_2)
number_2 = DoubleInput(0)
XYZ = XYZ(number_2, number_2, number_2)
family_type_selector = FamilyTypeSelector(index=5)
# note: need level picker for level 1
level_5 = Level(number)
family_instance_by_level_creator = FamilyInstanceCreatorLevel(XYZ, family_type_selector, level_5)
family_curve_loop = Function(number_2, family_instance_by_level_creator)
watch_2 = Watch(family_curve_loop)
