# Dynamo graph Dynamic Relaxation Arduino.dyn

# note: Number of Nodes in X
number_slider = DoubleSliderInput(20, range=0..30)
number = DoubleInput(10)
# note: Dampening
number_slider_2 = DoubleSliderInput(0.6363636364, range=0..5)
# note: Spring Constant
number_slider_3 = DoubleSliderInput(10, range=0..10)
# note: Rest Length
number_slider_4 = DoubleSliderInput(20.72727273, range=0..40)
# note: Mass of Node
number_slider_5 = DoubleSliderInput(10, range=0..10)
arduino = Arduino(number)
string_number = String2Num(arduino)
watch = Watch(string_number)
number_2 = DoubleInput(200)
division = Division(watch, number_2)
# note: Number of Nodes in Y
number_slider_6 = DoubleSliderInput(1, range=1..30)
# note: Gravity
number_slider_7 = DoubleSliderInput(-10, range=-10..10)
create_particle_system = DynamicRelaxation(number, number, number_slider_2, number_slider_3, number_slider_4, number_slider_5, division, number_slider_6, number_slider_7)
number_3 = DoubleInput(0.1)
execution_interval = ExecuteInterval(number_3)
dynamic_relaxation_loop = Function(create_particle_system, execution_interval)
