# Dynamo graph Dynamic Relaxation from Face.dyn

face_by_selection = FormElementBySelection()
# note: Dampening
number_slider = DoubleSliderInput(0.6363636364, range=0..5)
# note: Spring Constant
number_slider_2 = DoubleSliderInput(10, range=0..10)
# note: Rest Length
number_slider_3 = DoubleSliderInput(20.72727273, range=0..40)
# note: Mass of Node
number_slider_4 = DoubleSliderInput(10, range=0..10)
# note: Number of Nodes in X
number_slider_5 = DoubleSliderInput(20, range=0..30)
# note: Number of Nodes in Y
number_slider_6 = DoubleSliderInput(1, range=1..30)
# note: Gravity
number_slider_7 = DoubleSliderInput(-10, range=-10..10)
create_particle_system_on_face = DynamicRelaxationOnFace(face_by_selection, number_slider, number_slider_2, number_slider_3, number_slider_4, number_slider_5, number_slider_6, number_slider_7)
number = DoubleInput(0.1)
execution_interval = ExecuteInterval(number)
dynamic_relaxation_loop = Function(create_particle_system_on_face, execution_interval)
