# Dynamo graph Dynamic Relaxation.dyn (Dynamo 0.6.2.14024)

number = DoubleInput(0)
number_2 = DoubleInput(10)
number_3 = DoubleInput(1)
number_sequence = NumberRange(number, number_2, number_3, lacing=Longest)
XYZ = Xyz(number_sequence, number_sequence, number, lacing=CrossProduct)
flatten_completely = FlattenList(XYZ)
list_length = Length(number_sequence)
slice_list = Slice(flatten_completely, list_length)
first_in_list = First(slice_list)
# note: Find the corner points of the grids to use as fixed points.
first_in_list_2 = First(first_in_list)
reverse = Reverse(first_in_list)
first_in_list_3 = First(reverse)
reverse_2 = Reverse(slice_list)
first_in_list_4 = First(reverse_2)
first_in_list_5 = First(first_in_list_4)
reverse_3 = Reverse(first_in_list_4)
first_in_list_6 = First(reverse_3)
list = NewList(index0=first_in_list_2, index1=first_in_list_3, index2=first_in_list_5, index3=first_in_list_6)
number_4 = DoubleInput(0.25)
number_5 = DoubleInput(0)
n2_pi = PiTimes2()  # "2*Pi"
# note: Visualize the fixed points.
ellipse_arc = EllipticalArc(list, number_4, number_4, number_5, n2_pi, lacing=Longest)
lines_through_xyz = CurvesThroughPoints(slice_list, lacing=Longest)
# note: Create a square grid of curves to use as springs.
flatten_completely_2 = FlattenList(lines_through_xyz)
transpose_lists = Transpose(slice_list)
lines_through_xyz_2 = CurvesThroughPoints(transpose_lists, lacing=Longest)
flatten_completely_3 = FlattenList(lines_through_xyz_2)
list_2 = NewList(index0=flatten_completely_2, index1=flatten_completely_3)
flatten_completely_4 = FlattenList(list_2)
number_6 = DoubleInput(100)
number_7 = DoubleInput(40000)
number_8 = DoubleInput(1)
boolean = BoolSelector(false)
number_9 = DoubleInput(1.01)
number_10 = DoubleInput(1)
number_11 = DoubleInput(32.2)
number_12 = DoubleInput(0.1)
# note: Create a particle system, passing in fixed points, curves to use as springs and some spring properties.
create_particle_system = DynamicRelaxation(list, flatten_completely_4, number_6, number_7, number_8, boolean, number_9, number_10, number_11, number_12)
number_13 = DoubleInput(1)
number_14 = DoubleInput(0.002)
# note: The analytical step. This will run until the maximum nodal velocity is below the threshold value.
dynamicRelaxationLoop = Custom[DynamicRelaxationLoop](ps=create_particle_system, update=number_13, step=number_14)
