# Dynamo graph arduino driving family instance.dyn

family_instance_by_selection = FamilyInstanceCreatorSelection()  # 1 picked in the model
family_instance_parameter = FamilyInstanceParameterSelector(family_instance_by_selection)
number = DoubleInput(300)
execution_interval = ExecuteInterval(number)
arduino = Arduino(execution_interval)
watch = Watch(arduino)
string_number = String2Num(watch)
set_instance_parameter = FamilyInstanceParameterSetter(family_instance_by_selection, family_instance_parameter, string_number)
get_instance_parameter = FamilyInstanceParameterGetter(set_instance_parameter, family_instance_parameter)
watch_2 = Watch(get_instance_parameter)
