# Dynamo graph web request.dyn (Dynamo 0.6.2.14024)

string = StringInput("https://github.com/ikeough/Dynamo/commits/master")
number = DoubleInput(10000)
execution_interval = ExecuteInterval(number)
web_request = WebRequest(string, execution_interval)
watch = Watch(web_request)
