# Dynamo graph Arc and Line.dyn (Dynamo 0.6.2.14024)

select_reference_point = PointBySelection()
xyz_from_reference_point = XyzFromReferencePoint(select_reference_point, lacing=Longest)
select_reference_point_2 = PointBySelection()
xyz_from_reference_point_2 = XyzFromReferencePoint(select_reference_point_2, lacing=Longest)
select_reference_point_3 = PointBySelection()
xyz_from_reference_point_3 = XyzFromReferencePoint(select_reference_point_3, lacing=Longest)
arc_by_start_middle_end = ArcStartMiddleEnd(xyz_from_reference_point, xyz_from_reference_point_2, xyz_from_reference_point_3, lacing=Longest)
model_curve = ModelCurve(arc_by_start_middle_end, lacing=Longest)
line_by_endpoints = LineBound(xyz_from_reference_point, xyz_from_reference_point_3, lacing=Longest)
list = NewList(index0=arc_by_start_middle_end, index1=line_by_endpoints)
watch_3d = Watch3D(list)
model_curve_2 = ModelCurve(line_by_endpoints, lacing=Longest)
