# Dynamo graph Arc from Ref Points.dyn

point_by_selection = PointBySelection()  # 1 picked in the model
point_by_selection_2 = PointBySelection()  # 1 picked in the model
point_by_selection_3 = PointBySelection()  # 1 picked in the model
arc_by_center_point = ArcStartMiddleEnd(point_by_selection, point_by_selection_2, point_by_selection_3)
xyz_basisz = XYZBasisZ()
xyz_zero = XYZZero()
plane = Plane(xyz_basisz, xyz_zero)
sketch_plane = SketchPlane(plane)
model_curve = ModelCurve(arc_by_center_point, sketch_plane)
watch = Watch(model_curve)
list = NewList(item_s=arc_by_center_point)
watch_3d = dyn3DPreview(list)
xyz_from_ref_point = XYZFromReferencePoint()
