# Dynamo graph Arc.dyn

select_point = PointBySelection()
xyz_from_ref_point = XYZFromReferencePoint(select_point, lacing=Longest)
select_point_2 = PointBySelection()
xyz_from_ref_point_2 = XYZFromReferencePoint(select_point_2, lacing=Longest)
select_point_3 = PointBySelection()
xyz_from_ref_point_3 = XYZFromReferencePoint(select_point_3, lacing=Longest)
arc_by_center_point = ArcStartMiddleEnd(xyz_from_ref_point, xyz_from_ref_point_2, xyz_from_ref_point_3, lacing=Longest)
z_axis = XYZBasisZ(lacing=Longest)
xyz_zero = XYZZero(lacing=Longest)
plane = Plane(z_axis, xyz_zero, lacing=Longest)
sketch_plane = SketchPlane(plane, lacing=Longest)
model_curve = ModelCurve(arc_by_center_point, sketch_plane, lacing=Longest)
watch = Watch(model_curve)
list = NewList(item_s=arc_by_center_point)
watch_3d = Watch3D(list)
