# Dynamo graph circle.dyn

number_slider = DoubleSliderInput(0, range=0..100)
number = DoubleInput(0)
XYZ = XYZ(number_slider, number, number, lacing=Longest)
number_slider_2 = DoubleSliderInput(40.90909091, range=0..100)
circle = Circle(XYZ, number_slider_2, lacing=Longest)
z_axis = XYZBasisZ(lacing=Longest)
plane = Plane(z_axis, XYZ, lacing=Longest)
sketch_plane = SketchPlane(plane, lacing=Longest)
model_curve = ModelCurve(circle, sketch_plane, lacing=Longest)
select_curve = CurvesBySelection()  # 1 picked in the model
curve_from_curve_element = CurveFromModelCurve(select_curve, lacing=Longest)
list = NewList(item_s=circle, index1=curve_from_curve_element)
watch_3d = Watch3D(list)
