# Dynamo graph ellipse.dyn (Dynamo 0.6.2.14024)

number_slider = DoubleSliderInput(0, range=0..100)
number = DoubleInput(0)
XYZ = Xyz(number_slider, number, number, lacing=Longest)
number_slider_2 = DoubleSliderInput(30.909, range=0..200)
number_slider_3 = DoubleSliderInput(200, range=0..200)
ellipse = Ellipse(XYZ, number_slider_2, number_slider_3, lacing=Longest)
model_curve = ModelCurve(ellipse, lacing=Longest)
select_curve = CurvesBySelection()
curve_from_curve_element = CurveFromModelCurve(select_curve, lacing=Longest)
list = NewList(index0=curve_from_curve_element, index1=ellipse)
watch_3d = Watch3D(list)
