# Dynamo graph helix.dyn (Dynamo 0.6.2.14024)

number_slider = DoubleSliderInput(26.124, range=0..100)
python_script = Python(number_slider)
# ---------- python_script.python (36 lines) ----------
# adapted from Nathan Miller's Proving Ground Blog
# http://wiki.theprovingground.org/revit-api-py-curves


# Default imports
import clr
clr.AddReference('RevitAPI')
clr.AddReference('RevitAPIUI')
from Autodesk.Revit.DB import *
import Autodesk
import clr
import math
 
doc = __revit__.ActiveUIDocument.Document
app = __revit__.Application

scale = IN

xyzs = []
output = []

#use for loop to create a series of points
for i in range(0,20):
    x = math.sin(i)*scale
    y = math.cos(i)*scale
    z = i*scale/2
 
    myXYZ = XYZ(x,y,z)
    xyzs.append(myXYZ)

#create hermite spline
hs = app.Create.NewHermiteSpline(xyzs, False)
output.append(hs)
output.append(xyzs)

OUT = output;
# ----------------------------------------
watch_3d = Watch3D(python_script)
watch = Watch(python_script)
first_of_list = First(python_script)
model_curve = ModelCurve(first_of_list, lacing=Longest)
