# Dynamo graph CSV to Stuff.dyn

family_type_selector = FamilyTypeSelector()
# note: connect Watch 3d to these
# to make Revit Stuff
family_instance_creator = FamilyInstanceCreatorXYZ(arg1=family_type_selector)
reference_point = ReferencePointByXYZ()
filename = StringFilename("C:\Users\Ian\Documents\GitHub\Dynamo\bin\Debug\Samples\15 CSV to Points\helix.csv")
# note: Readfile, String, Split String, and Parse List of Lists
# Can be made into a single file.  See 02 file.
read_file = FileReader(filename)
string = StringInput("%0a")
split_string = SplitString(read_file, string)
number_slider = DoubleSliderInput(12.72775603, range=0..100)
parse_list_of_lists = Custom[Parse List of Lists](list=split_string, multiplier=number_slider)
xyz_from_list_of_numbers = XYZFromListOfNumbers(parse_list_of_lists)
watch_3d = Watch3D(xyz_from_list_of_numbers)
watch = Watch(xyz_from_list_of_numbers)
