# Dynamo graph CSV to Stuff_compact.dyn

filename = StringFilename("C:\Autodesk\16 CSV to Points\helix_smaller.csv")
number_slider = DoubleSliderInput(10.1010101, range=0..20)
csv_to_xyz = Custom[CSV to XYZ](path=filename, multiplier=number_slider)
watch_3d = dyn3DPreview(csv_to_xyz)
family_type_selector = FamilyTypeSelector()
family_instance_creator = FamilyInstanceCreatorXYZ(arg1=family_type_selector)
