# Dynamo graph LeapTower.dyn

number_slider = DoubleSliderInput(600, range=0..600)
# note: top
level = Level(number_slider)
number_slider_2 = DoubleSliderInput(100, range=0..100)
level_2 = Level(number_slider_2)
# note: Base
number = DoubleInput(0)
# note: need level picker for level 1
level_3 = Level(number)
# note: Mid
# note: Lower Floor To Floor
number_slider_3 = DoubleSliderInput(20, range=0..20)
boolean = BoolSelector(false)
Array = Output(number, number_slider_2, number_slider_3, boolean)
watch = Watch(Array)
level_4 = Level(Array)
number_slider_4 = DoubleSliderInput(10, range=0..10)
Array_2 = Output(number_slider_2, number_slider, number_slider_4, boolean)  # "Array"
level_5 = Level(Array_2)
family_instance_by_selection = FamilyInstanceCreatorSelection()  # 1 picked in the model
family_instance_by_selection_2 = FamilyInstanceCreatorSelection()  # 1 picked in the model
family_instance_parameter = FamilyInstanceParameterSelector(family_instance_by_selection_2)
number_2 = DoubleInput(10)
execution_interval = ExecuteInterval(number_2)
leap = LeapController(execution_interval)
leap_frame = LeapFrame(leap)
leap_hand_2 = LeapHand2(leap_frame)
leap_finger_1 = LeapFinger1(leap_hand_2)
leap_position = LeapPosition(leap_finger_1)
leap_finger_2 = LeapFinger2(leap_hand_2)
leap_position_2 = LeapPosition(leap_finger_2)
xyz_distance = XYZDistance(leap_position, leap_position_2)
set_instance_parameter = FamilyInstanceParameterSetter(family_instance_by_selection, family_instance_parameter, xyz_distance)
family_instance_parameter_2 = FamilyInstanceParameterSelector(family_instance_by_selection)
number_slider_5 = DoubleSliderInput(50, range=50..100)
set_instance_parameter_2 = FamilyInstanceParameterSetter(set_instance_parameter, family_instance_parameter_2, number_slider_5)
number_slider_6 = DoubleSliderInput(0, range=0..100)
number_slider_7 = DoubleSliderInput(90, range=50..100)
family_instance_by_selection_3 = FamilyInstanceCreatorSelection()  # 1 picked in the model
number_slider_8 = DoubleSliderInput(0, range=0..100)
set_instance_parameter_3 = FamilyInstanceParameterSetter(family_instance_by_selection_3, family_instance_parameter, number_slider_8)
leap_hand_1 = LeapHand1(leap_frame)
leap_finger_1_2 = LeapFinger1(leap_hand_1)
leap_position_3 = LeapPosition(leap_finger_1_2)
leap_finger_2_2 = LeapFinger2(leap_hand_1)
leap_position_4 = LeapPosition(leap_finger_2_2)
xyz_distance_2 = XYZDistance(leap_position_3, leap_position_4)
number_3 = DoubleInput(50)
add = Addition(xyz_distance_2, number_3)
set_instance_parameter_4 = FamilyInstanceParameterSetter(set_instance_parameter_3, family_instance_parameter_2, add)
number_slider_9 = DoubleSliderInput(0, range=0..100)
set_instance_parameter_5 = FamilyInstanceParameterSetter(family_instance_by_selection_2, family_instance_parameter, number_slider_9)
number_slider_10 = DoubleSliderInput(65, range=50..100)
set_instance_parameter_6 = FamilyInstanceParameterSetter(set_instance_parameter_5, family_instance_parameter_2, number_slider_10)
