# Dynamo graph CSV to Stuff.dyn (Dynamo 0.6.2.14024)

# note: Browse a CSV file that has numbers
# in x, y, and z coordinate space
file_path = StringFilename("C:\Users\kronz\Share\Dropbox\AU2013_AB2551\Samples\15 Spreadsheets\helix.csv")
read_text_file = FileReader(file_path)
# note: Split the String on
# A carriage return <enter>
string = StringInput("\n")
split_string = SplitString(read_text_file, string)
# note: Custom Node.
# Double click to look inside
parse_list_of_lists = Custom[Parse List of Lists](list=split_string)
number_slider = DoubleSliderInput(1.639, range=0..20)
# note: Adjust the overall distribution
# of the coordinate points
scale_xyz = XyzScale(parse_list_of_lists, number_slider, lacing=Longest)
# note: Visualize XYZs in the Watch 3d
# before making Revit Elements
watch_3d = Watch3D(scale_xyz)
# note: connect Watch 3d to make Revit
# Reference Points
reference_point = ReferencePointByXyz(lacing=Longest)
# note: Pick a loaded family from the
# dropdown to place
select_family_type = FamilyTypeSelector()
# note: Connect to Watch 3d to place families
create_family_instance = FamilyInstanceCreatorXyz(arg1=select_family_type, lacing=Longest)
