# Dynamo graph 2dDomain.dyn

# note: Connect these to
# make Revit Stuff
# note: Swap these connections
# For different patterning

number = DoubleInput(0.5)
UV = Uv(number, number, lacing=Longest)
number_2 = DoubleInput(1)
UV_2 = Uv(number_2, number_2, lacing=Longest)
domain_2d = Domain2D(UV, UV_2)
number_slider = DoubleSliderInput(24.02298851, range=0..40)
uv_random = UvRandom(domain_2d, number_slider, number_slider)
number_3 = DoubleInput(2)
UV_3 = Uv(number, number_3, lacing=Longest)
domain_2d_2 = Domain2D(UV_2, UV_3)
formula = Formula("x/2", x=number_slider, lacing=Longest)
uv_grid = UvGrid(domain_2d_2, formula, formula)
list = NewList(index0=uv_random, index1=uv_grid)
flatten_completely = FlattenList(list)
select_face = FormElementBySelection()  # 1 picked in the model
evaluate_uv = XyzEvaluate(flatten_completely, select_face, lacing=Longest)
watch_3d = Watch3D(evaluate_uv)
