# Dynamo graph tesselation with coincident grids.dyn (Dynamo 0.7.0.25764)

select_face = DSFaceSelection()  # 1 picked in the model
get_surface_domain = CodeBlock { {{0,0},{1,1}}; }
double_slider = DoubleSlider(10.136, range=0..20)
code_block = CodeBlock(domain=get_surface_domain, ucount=double_slider, vcount=double_slider) { domain[0][0]..domain[1][0]..#ucount+1; domain[0][1]..domain[1][1]..#vcount+1; }
byCoordinates = UV.ByCoordinates(code_block.out0, code_block.out1, lacing=CrossProduct)
flatten = Flatten(byCoordinates)
U = UV.U(flatten)
V = UV.V(flatten)
pointAtParameter = Surface.PointAtParameter(select_face, U, V, lacing=Longest)
# note: Wiggle Sliders
# for Awesome
double_slider_2 = DoubleSlider(6.515, range=0..20)
code_block_2 = CodeBlock(domain=get_surface_domain, ucount=double_slider_2, vcount=double_slider_2) { domain[0][0]..domain[1][0]..#ucount+1; domain[0][1]..domain[1][1]..#vcount+1; }
byCoordinates_2 = UV.ByCoordinates(code_block_2.out0, code_block_2.out1, lacing=CrossProduct)
flatten_2 = Flatten(byCoordinates_2)
byParametersOnSurface = Tessellation.Voronoi.ByParametersOnSurface(flatten_2, select_face)
create_list = List.Create(pointAtParameter, byParametersOnSurface)
watch_3d = Watch3D(create_list)
byCurve = ModelCurve.ByCurve(lacing=Longest)
