# Dynamo graph tesselation.dyn (Dynamo 0.6.2.14024)

# note: Connect these to
# make Revit Stuff
# note: Swap these connections
# For different patterning

select_face = FormElementBySelection()  # 1 picked in the model
get_surface_domain = SurfaceDomain(select_face, lacing=Longest)
number_slider = DoubleSliderInput(13.981, range=0..40)
uv_grid = UvGrid(get_surface_domain, number_slider, number_slider)
uv_random = UvRandom(get_surface_domain, number_slider, number_slider)
voronoi_on_face = VoronoiOnFace(uv_random, select_face, lacing=Longest)
watch_3d = Watch3D(voronoi_on_face)
model_curve = ModelCurve(lacing=Longest)
