# Dynamo graph tesselation_types.dyn (Dynamo 0.6.2.14024)

select_face = FormElementBySelection()  # 1 picked in the model
get_surface_domain = SurfaceDomain(select_face, lacing=Longest)
number_slider = DoubleSliderInput(6.817, range=0..40)
uv_random = UvRandom(get_surface_domain, number_slider, number_slider)
voronoi_on_face = VoronoiOnFace(uv_random, select_face, lacing=Longest)
watch_3d = Watch3D(voronoi_on_face)
evaluate_uv = XyzEvaluate(uv_random, select_face, lacing=Longest)
delaunay_on_face = DelaunayOnFace(uv_random, select_face, lacing=Longest)
watch_3d_2 = Watch3D(delaunay_on_face)
# note: Swap these connections
# For different patterning
watch_3d_3 = Watch3D()
watch_3d_4 = Watch3D()
