# Dynamo graph Translate and Rotate sequence.dyn

xyz_zero = XYZZero()
xyz_basisz = XYZBasisZ()
number = DoubleInput(0.1)
number_slider = DoubleSliderInput(4.66247191, range=0..6.24)
number_2 = DoubleInput(0.25)
number_sequence = BuildSeq(number, number_slider, number_2)
transform_rotation = TransformRotation(xyz_zero, xyz_basisz, number_sequence, lacing=Longest)
xyz_basisx = XYZBasisX()
xyz_scale = XYZScale(xyz_basisx, number_sequence, lacing=Longest)
transform_point = TransformPoint(transform_rotation, xyz_scale, lacing=Longest)
line = LineBound(xyz_zero, transform_point, lacing=Longest)
watch_3d = Watch3D(line)
watch = Watch(line)
number_3 = DoubleInput(1)
get_from_list = GetFromList(number_3, number_sequence)
watch_2 = Watch(get_from_list)
