# Dynamo graph Translate and Rotate.dyn (Dynamo 0.6.2.14024)

XYZ = Xyz(lacing=Longest)
z_axis = XyzBasisZ(lacing=Longest)
number_slider = DoubleSliderInput(1.004137931, range=0..6.24)
rotate_transform = TransformRotation(XYZ, z_axis, number_slider, lacing=Longest)
x_axis = XyzBasisX(lacing=Longest)
number_slider_2 = DoubleSliderInput(5.879, range=0..10)
scale_xyz = XyzScale(x_axis, number_slider_2, lacing=Longest)
transform_xyz = TransformPoint(rotate_transform, scale_xyz, lacing=Longest)
line_by_endpoints = LineBound(XYZ, transform_xyz, lacing=Longest)
watch_3d = Watch3D(line_by_endpoints)
