# Dynamo graph Adaptive Component Placement.dyn

list = NewList()
number = DoubleInput(0)
select_curve = CurvesBySelection()  # 1 picked in the model
select_curve_2 = CurvesBySelection()  # 1 picked in the model
select_curve_3 = CurvesBySelection()  # 1 picked in the model
list_2 = NewList(item_s=select_curve, index1=select_curve_2, index2=select_curve_3)
number_slider = DoubleSliderInput(18.28395062, range=0..20)
xyz_array_along_curve = XYZArrayAlongCurve(list_2, number_slider, lacing=Longest)
get_from_list = GetFromList(number, xyz_array_along_curve)
number_2 = DoubleInput(1)
get_from_list_2 = GetFromList(number_2, xyz_array_along_curve)
number_3 = DoubleInput(2)
get_from_list_3 = GetFromList(number_3, xyz_array_along_curve)
combine = Combine(list, get_from_list, get_from_list_2, get_from_list_3)
select_fam = FamilyTypeSelector(index=5)
adaptive_component_by_points = AdaptiveComponentByPoints(combine, select_fam, lacing=Longest)
watch_3d = Watch3D(xyz_array_along_curve)
