# Dynamo graph FormulaCurve.dyn (Dynamo 0.6.2.14024)

number = DoubleInput(0)
number_slider = DoubleSliderInput(6.283, range=0..6.283)
number_2 = DoubleInput(0.2)
number_range = NumberRange(number, number_slider, number_2, lacing=Longest)
formula = Formula("Sin(x)", x=number_range, lacing=Longest)
number_slider_2 = DoubleSliderInput(0.746183908, range=0..1)
multiply = Multiplication(number_range, number_slider_2, lacing=Longest)
formula_2 = Formula("Cos(x)+ Sin(a)", x=number_range, a=multiply, lacing=Longest)
formula_3 = Formula("Pow(x,2)", x=formula, lacing=Longest)
XYZ = Xyz(formula, formula_2, formula_3, lacing=Longest)
number_slider_3 = DoubleSliderInput(34.444, range=0..40)
scale_xyz = XyzScale(XYZ, number_slider_3, lacing=Longest)
hermite_spline = HermiteSpline(scale_xyz, lacing=Longest)
watch_3d = Watch3D(hermite_spline)
reference_curve = ReferenceCurve(hermite_spline, lacing=Longest)
