# Dynamo graph Scalable Circle.dyn (Dynamo 0.6.2.14024)

number = DoubleInput(0)
number_slider = DoubleSliderInput(4.622, range=0..6.24)
number_2 = DoubleInput(0.5)
number_sequence = NumberRange(number, number_slider, number_2)
formula = Formula("Sin(x)", x=number_sequence, lacing=Longest)
formula_2 = Formula("Cos(x)", x=number_sequence, lacing=Longest)
number_3 = DoubleInput(0)
XYZ = Xyz(formula, formula_2, number_3, lacing=Longest)
number_slider_2 = DoubleSliderInput(54.52928571, range=0..100)
scale_xyz = XyzScale(XYZ, number_slider_2, lacing=CrossProduct)
ref_point = ReferencePointByXyz(scale_xyz, lacing=Longest)
