# Dynamo graph Geometry Extraction.dyn

number = DoubleInput(0)
boolean = BoolSelector(true)
select_curve = CurvesBySelection()  # 1 picked in the model
select_curve_2 = CurvesBySelection()  # 1 picked in the model
list = NewList(item_s=select_curve, index1=select_curve_2)
boolean_2 = BoolSelector(false)
loft_form = LoftForm(boolean, list, boolean_2)
element_geometry_objects = ElementGeometryObjects(loft_form)
select_curve_3 = CurvesBySelection()  # 1 picked in the model
curve_from_curve_ele = CurveFromModelCurve(select_curve_3)
faces_of_solid_along_line = FacesByLine(element_geometry_objects, curve_from_curve_ele)
get_from_list = GetFromList(number, faces_of_solid_along_line)
surface_domain = SurfaceDomain(get_from_list)
get_from_list_2 = GetFromList(number, surface_domain)
number_slider = DoubleSliderInput(7.777777778, range=0..20)
uv_grid = UVGrid(get_from_list_2, number_slider, number_slider)
evaluate_uv = XYZEvaluate(uv_grid, get_from_list, lacing=Longest)
watch_3d = Watch3D(evaluate_uv)
ref_point = ReferencePointByXYZ(lacing=Longest)
