# Dynamo graph Geometry Extraction_surface varieties.dyn

# note: Select Object
select_model_element = ModelElementSelection()  # 1 picked in the model
element_geometry_objects = ElementGeometryObjects(select_model_element)
explode_geometry_object = GeometryObjectsFromRoot(element_geometry_objects)
watch = Watch(explode_geometry_object)
number = DoubleInput(0)
get_from_list = GetFromList(number, explode_geometry_object)
watch_2 = Watch(get_from_list)
# note: Switch Faces
number_slider = DoubleSliderInput(2.055555556, range=0..6)
get_from_list_2 = GetFromList(number_slider, get_from_list)
surface_domain = SurfaceDomain(get_from_list_2)
number_2 = DoubleInput(10)
uv_grid = UVGrid(surface_domain, number_2, number_2)
evaluate_uv = XYZEvaluate(uv_grid, get_from_list_2, lacing=Longest)
watch_3d = Watch3D(evaluate_uv)
# note: Type of Face
watch_3 = Watch(get_from_list_2)
# note: Make Points on Face
ref_point_on_face_by_uv = PointOnFaceUV(get_from_list_2, uv_grid, lacing=Longest)
