# Dynamo graph FormulaCurve.dyn

number = DoubleInput(0)
number_slider = DoubleSliderInput(6.2831, range=0..6.2831)
number_2 = DoubleInput(0.2)
number_sequence = BuildSeq(number, number_slider, number_2)
formula = Formula("Sin(x)", x=number_sequence, lacing=Longest)
number_slider_2 = DoubleSliderInput(0.1135802469, range=0..1)
multiply = Multiplication(number_sequence, number_slider_2, lacing=Longest)
formula_2 = Formula("Cos(x)+ Sin(a)", x=number_sequence, a=multiply, lacing=Longest)
formula_3 = Formula("Pow(x,2)", x=formula, lacing=Longest)
XYZ = XYZ(formula, formula_2, formula_3, lacing=Longest)
number_slider_3 = DoubleSliderInput(34.44444444, range=0..40)
scale_xyz = XYZScale(XYZ, number_slider_3, lacing=Longest)
hermite_spline = HermiteSpline(scale_xyz)
watch_3d = Watch3D(hermite_spline)
ref_point = ReferencePointByXYZ(scale_xyz, lacing=Longest)
boolean = BoolSelector(true)
curve_by_pts = CurveByPoints(ref_point, boolean, lacing=Longest)
