# Dynamo graph Spiral.dyn

ref_point = ReferencePointByXYZ(lacing=Longest)
number = DoubleInput(0)
number_slider = DoubleSliderInput(5.212645926, range=0..6.2831)
number_2 = DoubleInput(0.6)
number_sequence = BuildSeq(number, number_slider, number_2)
formula = Formula("Sin(x)", x=number_sequence, lacing=Longest)
formula_2 = Formula("Cos(x)+ Sin(x*.3)", x=number_sequence, lacing=Longest)
XYZ = XYZ(formula, formula_2, number, lacing=Longest)
number_slider_2 = DoubleSliderInput(6.49382716, range=0..40)
scale_xyz = XYZScale(XYZ, number_slider_2, lacing=Longest)
watch_3d = Watch3D(scale_xyz)
curve_by_pts = CurveByPoints(lacing=Longest)
