# Dynamo graph DataToFamilies.dyn (Dynamo 0.6.2.14024)

# note: Select all the Families on a Divided Surface
select_divided_surface_families = DividedSurfaceBySelection()  # 1 picked in the model
flatten_completely = FlattenList(select_divided_surface_families)
string = StringInput("opening")
# note: Simple Number Sequence
number = DoubleInput(.1..0.4..#100)
set_family_instance_parameter = FamilyInstanceParameterSetter(flatten_completely, string, number, lacing=Longest)
# note: Data from an Image
file_path = StringFilename("C:\Users\kronz\Share\Dropbox\AU2013_AB2551\Samples\20 Panel Manipulations\grayscale3.bmp")
number_2 = DoubleInput(10)
read_image_file = ImageFileReader(file_path, number_2, number_2)
color_brightness = ColorBrightness(read_image_file, lacing=Longest)
formula = Formula("x*.4", x=color_brightness, lacing=Longest)
# note: Get Center and Normal of Each Panel
get_family_instance_location = GetFamilyInstanceLocation(select_divided_surface_families, lacing=Longest)
number_3 = DoubleInput(1)
flatten = FlattenListAmt(get_family_instance_location, number_3)
best_fit_plane = BestFitPlane(flatten, lacing=Longest)
# note: Offset Normal and Sun Vector from Panel Origin
add_xyzs = XyzAdd(best_fit_plane.out2, best_fit_plane.out1, lacing=Longest)
# note: Data From Sun Orientation
sunpath_direction = SunPathDirection()  # 1 picked in the model
unitize_xyz = XyzNormalize(sunpath_direction, lacing=Longest)
add_xyz = XyzAdd(best_fit_plane.out2, unitize_xyz, lacing=Longest)
# note: Measure Distance between  Normal and Sun Vector
xyz_distance = XyzDistance(add_xyzs, add_xyz, lacing=Longest)
formula_2 = Formula("x/4", x=xyz_distance, lacing=Longest)
# note: Data From Excel
file_path_2 = StringFilename("C:\Users\kronz\Documents\GitHub\Dynamo\doc\distrib\Samples\20 Panel Manipulations\dataStream.xlsx")
open_excel_workbook = ReadExcelFile(file_path_2)
string_2 = StringInput("Sheet1")
get_excel_worksheet_by_name = GetExcelWorksheetByName(open_excel_workbook, string_2)
get_data_from_excel_worksheet = GetDataFromExcelWorksheet(get_excel_worksheet_by_name)
flatten_completely_2 = FlattenList(get_data_from_excel_worksheet)
number_4 = DoubleInput(3)
build_sublists = Sublists("2", flatten_completely_2, number_4, lacing=Longest)
flatten_completely_3 = FlattenList(build_sublists)
line_by_endpoints = LineBound(add_xyzs, add_xyz, lacing=Longest)
