# Dynamo graph Quads From Rectangular Grid.dyn (Dynamo 0.6.2.32011)

# note: Number of Rows
number = DoubleInput(8)
number_2 = DoubleInput(0..end, number, lacing=Longest)
number_3 = DoubleInput(0)
# note: Grid of Points
# note: Point List
XYZ = Xyz(number_2, number_2, number_3, lacing=CrossProduct)
# note: Custom Node.  If this is red, got to Packages>Search for a Package, and search for it by name.  Download, then re-open this dyn file
quads_from_rectangular_grid = Custom[Quads from Rectangular Grid](Row_Number=number, Point_List=XYZ)  # Given a grid of points (xyz or uv) create a list of quadrilaterals
watch = Watch(quads_from_rectangular_grid)
nurbs_spline = GeometryCurveNurbSpline(quads_from_rectangular_grid, lacing=Longest)
watch_3d = Watch3D(nurbs_spline)
