# Dynamo graph Recursion.dyn (Dynamo 0.6.2.32011)

number = DoubleInput(0)
number_2 = DoubleInput(1)
number_3 = DoubleInput(10)
# note: If this node is red, go to Packages>Search for a Package, search for fibonacci_Recursion Lesson, download and re-open this dyn file.
# Then double click to open this custom node.
fibonacci_recursion_lesson = Custom[fibonacci_Recursion Lesson](Start=number, Next=number_2, ListLength=number_3)  # This is a partially complete node. It can be used to teach creation of recursive functionality
watch = Watch(fibonacci_recursion_lesson)
