# Dynamo graph AnalysisDisplay_Points.dyn (Dynamo 0.6.2.18287)

integer_slider = IntegerSliderInput(4, range=0..10)
formula = Formula("x+1", x=integer_slider, lacing=Longest)
number = DoubleInput(3)
power = Pow(formula, number, lacing=Longest)
formula_2 = Formula("x-1", x=power, lacing=Longest)
number_2 = DoubleInput(0..end, formula_2, lacing=Longest)
number_3 = DoubleInput(0..end, integer_slider, lacing=Longest)
XYZ = Xyz(number_3, number_3, number_3, lacing=CrossProduct)
number_4 = DoubleInput(10)
scale_xyz = XyzScale(XYZ, number_4, lacing=Longest)
flatten_completely = FlattenList(scale_xyz)
number_5 = DoubleInput(1)
analysis_display_manager = SpatialFieldManager(number_5, lacing=Longest)
display_analysis_points = SpatialFieldPoints(number_2, flatten_completely, analysis_display_manager)
list_length = Length(flatten_completely)
watch = Watch(list_length)
list_length_2 = Length(number_2)
watch_2 = Watch(list_length_2)
color = Color(lacing=Longest)
