# Dynamo graph AnalysisDisplay_Surface.dyn (Dynamo 0.6.2.21812)

integer_slider = IntegerSliderInput(8, range=0..10)
formula = Formula("pow(a,2)", a=integer_slider, lacing=Longest)
number = DoubleInput(0..100..#count, formula, lacing=Longest)
number_2 = DoubleInput(0..1..#count, integer_slider, lacing=Longest)
UV = Uv(number_2, number_2, lacing=CrossProduct)
flatten_completely = FlattenList(UV)
number_3 = DoubleInput(1)
analysis_display_manager = SpatialFieldManager(number_3, lacing=Longest)
select_face = FormElementBySelection()  # 1 picked in the model
display_analysis_surface = SpatialFieldFace(number, flatten_completely, analysis_display_manager, select_face)
