# Dynamo graph OverrideGraphicsInView_Families.dyn (Dynamo 0.7.0.29305)

number = DoubleInput(0)
number_2 = DoubleInput(255)
color = Color(number, number, number_2, number, lacing=Longest)
number_3 = DoubleInput(0)
number_4 = DoubleInput(255)
color_2 = Color(number_3, number_4, number_3, number_3, lacing=Longest)
select_family_type = FamilyTypeSelector(index=7)
# note: get family instances
get_family_instances_by_type = GetFamilyInstancesByType(select_family_type)
# note: chose family parameter to track
string = StringInput("deflection")
get_family_instance_parameter = FamilyInstanceParameterGetter(get_family_instances_by_type, string, lacing=Longest)  # "Get Family Instance Parameter Value"
sort = Sort(get_family_instance_parameter)
# note: get highest value
reverse = Reverse(sort)
first_of_list = First(reverse)
formula = Formula("x/y", x=get_family_instance_parameter, y=first_of_list, lacing=Longest)
# note: set color range
color_range = ColorRange(color, color_2, formula, lacing=Longest)
override_element_color_in_view = OverrideColorInView(color_range, get_family_instances_by_type, lacing=Longest)
number_5 = DoubleInput(0.5)
# note: normalize at highest value
# note: identify panels within a tolerance
# note: or
formula_2 = Formula("if(x>y,1,0)", x=get_family_instance_parameter, y=number_5, lacing=Longest)
