# Dynamo graph OverrideGraphicsInView_Walls.dyn (Dynamo 0.7.0.29305)

number = DoubleInput(0)
number_2 = DoubleInput(255)
color = Color(number, number, number_2, number, lacing=Longest)
number_3 = DoubleInput(0)
number_4 = DoubleInput(255)
color_2 = Color(number_3, number_4, number_3, number_3, lacing=Longest)
# note: set color range
color_range = ColorRange(color, color_2)
XYZ = Xyz(lacing=Longest)
number_slider = DoubleSliderInput(3.57015873, range=1..25)
number_5 = DoubleInput(0..50..x, number_slider, lacing=Longest)
XYZ_2 = Xyz(number_5, lacing=Longest)
xyz_distance = XyzDistance(XYZ, XYZ_2, lacing=Longest)
formula = Formula("x/50", x=xyz_distance, lacing=Longest)
map = Map(color_range, formula)
number_6 = DoubleInput(10)
XYZ_3 = Xyz(arg1=number_6, lacing=Longest)
add_xyzs = XyzAdd(XYZ_2, XYZ_3, lacing=Longest)
line_by_endpoints = LineBound(XYZ_2, add_xyzs, lacing=Longest)
select_level_from_list = SelectLevel(index=0)
select_wall_type = SelectWallType(index=1)
number_7 = DoubleInput(10)
wall_by_curve = WallByCurve(line_by_endpoints, select_level_from_list, select_wall_type, number_7, lacing=Longest)
override_element_color_in_view = OverrideColorInView(map, wall_by_curve, lacing=Longest)
