# Dynamo graph ExcelDataExport.dyn (Dynamo 0.6.0.26602)

number = DoubleInput(40)
number_2 = DoubleInput(19)
number_3 = DoubleInput(1..60..#20)
number_4 = DoubleInput(0)
number_5 = DoubleInput(0)
# note: Define Setting Out Point Geometry
XYZ = Xyz(number_3, number_4, number_5, lacing=Longest)
number_6 = DoubleInput(20)
number_7 = DoubleInput(0.4..2.5..#20)
formula = Formula("sin(x)*20", x=number_7, lacing=Longest)
XYZ_2 = Xyz(number_3, number_6, formula, lacing=Longest)
formula_2 = Formula("sin(x)*20+20", x=number_7, lacing=Longest)
number_8 = DoubleInput(0)
XYZ_3 = Xyz(number_3, formula_2, number_8, lacing=Longest)
list = NewList(index0=XYZ, index1=XYZ_2, index2=XYZ_3)
transpose_lists = Transpose(list)
hermite_spline = HermiteSpline(transpose_lists, lacing=Longest)
# note: Create Ribs and Point Arrays on Ribs
number_9 = DoubleInput(10)
xyz_array_on_curve = XyzArrayAlongCurve(hermite_spline, number_9, lacing=Longest)
transpose_lists_2 = Transpose(xyz_array_on_curve)
flatten_completely = FlattenList(transpose_lists_2)
# note: Custom Node.  If this is red, got to Packages>Search for a Package, and search for it by name.  Download, then re-open this dyn file
# note: Define Panel Geometry
quads_from_rectangular_grid = Custom[Quads from Rectangular Grid](Row_Number=number_2, Point_List=flatten_completely)  # Given a grid of points (xyz or uv) create a list of quadrilaterals
lines_through_xyz = CurvesThroughPoints(quads_from_rectangular_grid, lacing=Longest)
select_family_type = FamilyTypeSelector()
# note: Make Linework for Panels or assign Component Families if needed
adaptive_component_by_xyzs = AdaptiveComponentByPoints(arg1=select_family_type, lacing=Longest)
# note: Group XYZ Components as Lists of 3
list_2 = NewList()
# note: Extract XYZ Components
xyz_x = XyzGetX(lacing=Longest)
flatten_completely_2 = FlattenList(quads_from_rectangular_grid)
map = Map(xyz_x, flatten_completely_2)
xyz_y = XyzGetY(lacing=Longest)
map_2 = Map(xyz_y, flatten_completely_2)
xyz_z = XyzGetZ(lacing=Longest)
map_3 = Map(xyz_z, flatten_completely_2)
combine = Combine(list_2, map, map_2, map_3)
# note: Make Groups of 12 (4 points, made of 3 pieces of data each)
flatten_completely_3 = FlattenList(combine)
number_10 = DoubleInput(12)
partition_list = Slice(flatten_completely_3, number_10)
watch = Watch(partition_list)
new_excel_workbook = NewExcelWorkbook()
string = StringInput("C:\Autodesk\Dynamo\Core\samples\23 Data Import and Export\DataExport")
save_excel_workbook_as = SaveAsExcelWorkbook(new_excel_workbook, string)
string_2 = StringInput("Sheet1")
# note: Write Each Panel as a Row of 12 numbers each to Excel
get_excel_worksheet_by_name = GetExcelWorksheetByName(save_excel_workbook_as, string_2)
write_data_to_excel_worksheet = WriteDataToExcelWorksheet(get_excel_worksheet_by_name, arg3=partition_list)
model_curve = ModelCurve(lacing=Longest)
