# Dynamo graph ExcelDataExtract.dyn (Dynamo 0.6.0.26602)

select_family_type = FamilyTypeSelector()
# note: Extract XYZ data from four point loaded families
get_family_instances_by_type = GetFamilyInstancesByType(select_family_type)
get_family_instance_location = GetFamilyInstanceLocation(get_family_instances_by_type, lacing=Longest)
lines_through_xyz = CurvesThroughPoints(get_family_instance_location, lacing=Longest)
# note: Write each panel as a row of 12 numbers in Excel
new_excel_workbook = NewExcelWorkbook()
string = StringInput("C:\Autodesk\Dynamo\Core\samples\23 Data Import and Export\ExtractData")
save_excel_workbook_as = SaveAsExcelWorkbook(new_excel_workbook, string)
string_2 = StringInput("Sheet1")
get_excel_worksheet_by_name = GetExcelWorksheetByName(save_excel_workbook_as, string_2)
# note: Combine XYZ components into a list of x, y, and z
list = NewList()
# note: Separate XYZ into components
xyz_x = XyzGetX(lacing=Longest)
flatten_completely = FlattenList(get_family_instance_location)
map = Map(xyz_x, flatten_completely)
xyz_y = XyzGetY(lacing=Longest)
map_2 = Map(xyz_y, flatten_completely)
xyz_z = XyzGetZ(lacing=Longest)
map_3 = Map(xyz_z, flatten_completely)
combine = Combine(list, map, map_2, map_3)
# note: Break into Rows of data, each row has 12 numbers to define 4 panel points
flatten_completely_2 = FlattenList(combine)
number = DoubleInput(12)
partition_list = Slice(flatten_completely_2, number)
write_data_to_excel_worksheet = WriteDataToExcelWorksheet(get_excel_worksheet_by_name, arg3=partition_list)
watch = Watch(partition_list)
