# Dynamo graph ExcelDataImport.dyn (Dynamo 0.7.0.4515)

# note: Sort numbers into XYZ coordinate elements
xyz_from_list_of_numbers = XyzFromListOfNumbers()
# note: Pull Quadrilateral Point Data from an Excel workbook
file_path = StringFilename("C:\Autodesk\Dynamo\Core\samples\23 Data Import and Export\DataImport.xlsx")
open_excel_workbook = ReadExcelFile(file_path)
string = StringInput("Sheet1")
get_excel_worksheet_by_name = GetExcelWorksheetByName(open_excel_workbook, string)
get_data_from_excel_worksheet = GetDataFromExcelWorksheet(get_excel_worksheet_by_name)
map = Map(xyz_from_list_of_numbers, get_data_from_excel_worksheet)
# note: Make Components or Model Lines
adaptive_component_by_xyzs = AdaptiveComponentByPoints(map, lacing=Longest)
select_family_type = FamilyTypeSelector()
lines_through_xyz = CurvesThroughPoints(map, lacing=Longest)
model_curve = ModelCurve(lines_through_xyz, lacing=Longest)
