# Dynamo graph WebRequest.dyn (Dynamo 0.6.0.21202)

number = DoubleInput(3)
string = StringInput("http://www.marketwatch.com/investing/stock/adsk/")
number_2 = DoubleInput(1000)
# note: Get Data from Internet and set refresh rate in milliseconds
execution_interval = ExecuteInterval(number_2)
web_request = WebRequest(string, execution_interval)
string_2 = StringInput("<span class=\"currency\">$</span>\n")
split_string = SplitString(web_request, string_2)
rest_of_list = Rest(split_string)
# note: Parse the incoming data
first_of_list = First(rest_of_list)
string_3 = StringInput(" ")
split_string_2 = SplitString(first_of_list, string_3)
get_from_list = GetFromList(number, split_string_2)
# note: Convert String data to Number
string_to_number = String2Num(get_from_list, lacing=Longest)
number_3 = DoubleInput(0..x, string_to_number, lacing=Longest)
XYZ = Xyz(arg2=number_3, lacing=Longest)
