# Dynamo graph BasicListManagement.dyn (Dynamo 0.6.1.18684)

number = DoubleInput(0)
number_slider = DoubleSliderInput(4.004, range=0..20)
number_2 = DoubleInput(1)
# note: Creates a list of numbers
number_range = NumberRange(number, number_slider, number_2, lacing=Longest)
# note: Watch:  Shows Data Sequence
watch = Watch(number_range)
# note: List of Numbers drives
# X Coordinate value
XYZ = Xyz(number_range, lacing=Longest)
number_3 = DoubleInput(0)
number_slider_2 = DoubleSliderInput(6.499, range=0..15)
number_4 = DoubleInput(1)
# note: Creates a second sequence of numbers
number_range_2 = NumberRange(number_3, number_slider_2, number_4, lacing=Longest)
number_5 = DoubleInput(4)
XYZ_2 = Xyz(number_range_2, number_5, lacing=Longest)
# note: Lines connected by 2 sequences
# of XYZ coordinates
line = LineBound(XYZ, XYZ_2, lacing=Longest)
# note: Watch 3D showing viewport with preview geometry
watch_3d = Watch3D(line)
number_6 = DoubleInput(0)
number_slider_3 = DoubleSliderInput(6.499, range=0..15)
number_7 = DoubleInput(1)
number_range_3 = NumberRange(number_6, number_slider_3, number_7, lacing=Longest)
# note: A sequence controls X and Y.
# Lacing set to 'Cross Product'
XYZ_3 = Xyz(number_range_3, number_range_3, lacing=CrossProduct)
# note: A grid of points.
watch_3d_2 = Watch3D(XYZ_3)
number_8 = DoubleInput(3)
# note: Get a single Item From list
get_from_list = GetFromList(number_8, XYZ_3)
watch_2 = Watch(get_from_list)
number_slider_4 = DoubleSliderInput(3.283, range=0..10)
# note: Take a number of items from the list
take_from_list = TakeList(number_slider_4, XYZ_3)
watch_3 = Watch(take_from_list)
watch_4 = Watch(XYZ)
