# Dynamo graph Nested Lists.dyn (Dynamo 0.6.1.18684)

integer_slider = IntegerSliderInput(10, range=0..10)
integer_slider_2 = IntegerSliderInput(6, range=0..10)
number = DoubleInput(1)
number_2 = DoubleInput(0)
number_3 = DoubleInput(1)
# note: 'Flat' 2D grid of XYZ coordinates
xyz_grid = ReferencePtGrid(integer_slider, integer_slider_2, number, number_2, number_2, number_2, number_3, number_3, number_3, lacing=Longest)
# note: XYZ grid list
watch_3d = Watch3D(xyz_grid)
# note: Use Slice List to define rows
# of XYZ within the grid.
slice_list = Slice(xyz_grid, integer_slider)
# note: XYZ List of Lists
watch = Watch(slice_list)
number_4 = DoubleInput(0)
# note: Flips the Nesting of the List
transpose_lists = Transpose(slice_list)
get_from_list = GetFromList(number_4, transpose_lists)
number_5 = DoubleInput(0.5)
circle = Circle(get_from_list, number_5, lacing=Longest)
# note: Pulls out the first row.
watch_3d_2 = Watch3D(circle)
# note: Flipped List of Lists
watch_2 = Watch(transpose_lists)
number_6 = DoubleInput(0)
get_from_list_2 = GetFromList(number_6, slice_list)
number_7 = DoubleInput(0.5)
circle_2 = Circle(get_from_list_2, number_7, lacing=Longest)
# note: Pulls out the first column.
watch_3d_3 = Watch3D(circle_2)
watch_3 = Watch(slice_list)
watch_4 = Watch(transpose_lists)
