# Dynamo graph PassingFunctions.dyn (Dynamo 0.6.0.14830)

list = NewList()
# note: Passing functions to other functions allows for a "do this to all these things" set of operations
number = DoubleInput(0..2)
number_2 = DoubleInput(3..5)
number_3 = DoubleInput(6..8)
# note: Sort data into different buckets
combine = Combine(list, number, number_2, number_3)
watch = Watch(combine)
reverse = Reverse()
list_2 = NewList(index0=number, index1=number_2, index2=number_3)
# note: Operate on data inside of lists
map = Map(reverse, list_2)
watch_2 = Watch(map)
watch_3 = Watch(list_2)
xyz_y = XyzGetY(lacing=Longest)
# note: Extract sortable information from a piece of data
reverse_2 = Reverse(number_3)
XYZ = Xyz(number, reverse_2, number_3, lacing=Longest)
sort_by_key = SortBy(xyz_y, XYZ)
watch_4 = Watch(sort_by_key)
watch_5 = Watch(XYZ)
