# Dynamo graph RangesAndSequences.dyn (Dynamo 0.6.2.21882)

number = DoubleInput(0)
number_2 = DoubleInput(10)
number_3 = DoubleInput(2)
number_sequence = NumberSeq(number, number_2, number_3, lacing=Longest)
watch = Watch(number_sequence)
number_4 = DoubleInput(0)
number_5 = DoubleInput(10)
number_6 = DoubleInput(2)
number_range = NumberRange(number_4, number_5, number_6, lacing=Longest)
watch_2 = Watch(number_range)
number_7 = DoubleInput(0..#10..2)
# note: insert ranges and sequences directly into number nodes following this syntax
# Start..End
# 0..4 will yield  0,1,2,3,4
# Start..End..Interval
# 0..4..2 will yield 0,2,4
# Start..End..#Count
# 0..1..#5 will yield 0, 0.25, 0.5, 0.75, 1
# Start..#List Length..Interval
# 0..#4..10 will yield 0,10,20,30
watch_3 = Watch(number_7)
number_8 = DoubleInput(0..10..2)
watch_4 = Watch(number_8)
number_9 = DoubleInput(0..4)
watch_5 = Watch(number_9)
number_10 = DoubleInput(0..#4..10)
watch_6 = Watch(number_10)
number_11 = DoubleInput(0..4..2)
watch_7 = Watch(number_11)
number_12 = DoubleInput(0..1..#5)
watch_8 = Watch(number_12)
# note: Additionally, you can insert variables within the ranges and sequences like 0..#a..50
number_13 = DoubleInput(0..6.000)
number_14 = DoubleInput(0..#a..50, number_13, lacing=Longest)
watch_9 = Watch(number_14)
