# Dynamo graph Daylighting Extracting Data.dyn (Dynamo 0.6.3.30451)

string = StringInput("{3D}")
export_render_data = ExportDocumentRenderData(string)
transaction = Transaction(export_render_data)
upload_render_data = UploadRenderData(transaction)
number = DoubleInput(150)
# note: when hitting run render will upload and take a few minutes to return - run button will grey out - check the console for progress
number_2 = DoubleInput(-100)
number_3 = DoubleInput(-100)
number_4 = DoubleInput(3)
XYZ = Xyz(number_2, number_3, number_4, lacing=Longest)
number_5 = DoubleInput(100)
number_6 = DoubleInput(-100)
number_7 = DoubleInput(3)
XYZ_2 = Xyz(number_5, number_6, number_7, lacing=Longest)
number_8 = DoubleInput(-100)
number_9 = DoubleInput(100)
number_10 = DoubleInput(3)
XYZ_3 = Xyz(number_8, number_9, number_10, lacing=Longest)
skymodel_type = SkymodelType(index=0)
daylighting_skymodel = MakeDaylightingSkyModel(skymodel_type, lacing=Longest)
number_11 = DoubleInput(40)
number_12 = DoubleInput(-71)
number_13 = DoubleInput(12)
number_14 = DoubleInput(-5)
dateTime = MakeDateTime(arg3=number_13, arg6=number_14, lacing=Longest)
daylighting_environment = MakeDaylightingEnvironmentData(daylighting_skymodel, number_11, number_12, dateTime, lacing=Longest)
cloud_daylighting_job = CloudDaylightingJob(string, number, number, XYZ, XYZ_2, XYZ_3, daylighting_environment, lacing=Longest)
boolean = BoolSelector(false)
cloud_render = CloudRender(upload_render_data, cloud_daylighting_job, boolean)
parse_daylighting_file = ParseSDF(cloud_render, lacing=Longest)
number_15 = DoubleInput(0)
get_daylighting_grid_image = GetDaylightingForegroundImage(parse_daylighting_file, number_15, lacing=Longest)
first_of_list = First(get_daylighting_grid_image)
watch_image = WatchImage(first_of_list)
number_16 = DoubleInput(1)
get_daylighting_grid_resolution = GetSDFResolution(parse_daylighting_file, number_15, lacing=Longest)
first_of_list_2 = First(get_daylighting_grid_resolution)
# note: Number Of Columns
get_from_list = GetFromList(number_16, first_of_list_2)
# note: Y
number_17 = DoubleInput(75)
multiply = Multiplication(get_from_list, number_17, lacing=Longest)
# note: X
# note: This lets us index into the list of colors, or illuminance values, and pull out the value at an (x,y) within the grid of values... not positions in space
number_18 = DoubleInput(75)
# note: Number Of Columns * Row + Column
add = Addition(multiply, number_18, lacing=Longest)
get_daylighting_grid_illuminance = GetDaylightingIlluminanceValues(parse_daylighting_file, number_15, lacing=Longest)  # "Get Daylighting Grid Illuminance Values"
illuminance_to_srgb = IlluminanceToSRGB(get_daylighting_grid_illuminance, lacing=Longest)
first_of_list_3 = First(illuminance_to_srgb)
# note: Use this position to lookup illuminance at a pixel coordinate
get_from_list_2 = GetFromList(add, first_of_list_3)
get_daylighting_grid_positions = GetDaylightingPositions(parse_daylighting_file, number_15, lacing=Longest)
# note: again we need to extract the first list of xyz positons because the render returns a list of grids ( if we had supplied multiple render jobs)
first_of_list_4 = First(get_daylighting_grid_positions)
number_19 = DoubleInput(-100)
number_20 = DoubleInput(-100)
number_21 = DoubleInput(3)
XYZ_4 = Xyz(number_19, number_20, number_21, lacing=Longest)
# note: use the exact position of an xyz in world coordinates to find an illumiance value by using the index of the XYZ in a list of sampling positons
indexOf = Python(first_of_list_4, XYZ_4)
# ---------- indexOf.python (22 lines) ----------
# Default imports
import clr
clr.AddReference('RevitAPI')
clr.AddReference('RevitAPIUI')
from Autodesk.Revit.DB import *
import Autodesk
import sys
import clr
path = r'C:\Autodesk\Dynamo\Core'
exec_path = r'C:\Autodesk\Dynamo\Core\dll'
sys.path.append(path)
sys.path.append(exec_path)
clr.AddReference('LibGNet')
from Autodesk.LibG import *

#The input to this node will be stored in the IN0...INX variable(s).
list = IN0
value = IN1

index, item = next(((i, x) for i, x in enumerate(list) if x.IsAlmostEqualTo(value,.01)), (None,None))

OUT = index
# ----------------------------------------
# note: use that index on the list of illuminance values
get_from_list_3 = GetFromList(indexOf, first_of_list_3)
