# Dynamo graph Daylighting Minimal.dyn (Dynamo 0.6.3.30451)

string = StringInput("{3D}")
export_render_data = ExportDocumentRenderData(string)
transaction = Transaction(export_render_data)
upload_render_data = UploadRenderData(transaction)
number = DoubleInput(150)
number_2 = DoubleInput(-100)
number_3 = DoubleInput(-100)
number_4 = DoubleInput(3)
XYZ = Xyz(number_2, number_3, number_4, lacing=Longest)
number_5 = DoubleInput(100)
number_6 = DoubleInput(-100)
number_7 = DoubleInput(3)
XYZ_2 = Xyz(number_5, number_6, number_7, lacing=Longest)
# note: Associated .rvt file in the same folder where this sample is found
number_8 = DoubleInput(-100)
number_9 = DoubleInput(100)
number_10 = DoubleInput(3)
XYZ_3 = Xyz(number_8, number_9, number_10, lacing=Longest)
# note: when hitting run render will upload and take a few minutes to return - run button will grey out - check the console for progress
skymodel_type = SkymodelType(index=0)
daylighting_skymodel = MakeDaylightingSkyModel(skymodel_type, lacing=Longest)
number_11 = DoubleInput(40)
number_12 = DoubleInput(-71)
number_13 = DoubleInput(12)
number_14 = DoubleInput(-5)
dateTime = MakeDateTime(arg3=number_13, arg6=number_14, lacing=Longest)
daylighting_environment = MakeDaylightingEnvironmentData(daylighting_skymodel, number_11, number_12, dateTime, lacing=Longest)
cloud_daylighting_job = CloudDaylightingJob(string, number, number, XYZ, XYZ_2, XYZ_3, daylighting_environment, lacing=Longest)
boolean = BoolSelector(false)
cloud_render = CloudRender(upload_render_data, cloud_daylighting_job, boolean)
parse_daylighting_file = ParseSDF(cloud_render, lacing=Longest)
number_15 = DoubleInput(0)
get_daylighting_grid_image = GetDaylightingForegroundImage(parse_daylighting_file, number_15, lacing=Longest)
first_of_list = First(get_daylighting_grid_image)
watch_image = WatchImage(first_of_list)
