# Dynamo graph Daylighting and Analysis Display.dyn (Dynamo 0.6.3.30451)

string = StringInput("{3D}")
export_render_data = ExportDocumentRenderData(string)
transaction = Transaction(export_render_data)
# note: Setup our render and push it to Autodesk 360 service
upload_render_data = UploadRenderData(transaction)
number = DoubleInput(150)
# note: Generate xyz corners for plane to sample
number_2 = DoubleInput(-100)
number_3 = DoubleInput(-100)
number_4 = DoubleInput(3)
XYZ = Xyz(number_2, number_3, number_4, lacing=Longest)
number_5 = DoubleInput(100)
number_6 = DoubleInput(-100)
number_7 = DoubleInput(3)
XYZ_2 = Xyz(number_5, number_6, number_7, lacing=Longest)
number_8 = DoubleInput(-100)
number_9 = DoubleInput(100)
number_10 = DoubleInput(3)
XYZ_3 = Xyz(number_8, number_9, number_10, lacing=Longest)
# note: There is an associated .rvt file in the rendering samples folder where this graph was located that is needed to run correctly.
# note: When you hit run there will be a delay as the rendering completes, watch the console for updates - run button will grey out for a few minutes.
skymodel_type = SkymodelType(index=0)
daylighting_skymodel = MakeDaylightingSkyModel(skymodel_type, lacing=Longest)
number_11 = DoubleInput(40)
number_12 = DoubleInput(-71)
number_13 = DoubleInput(12)
number_14 = DoubleInput(-5)
dateTime = MakeDateTime(arg3=number_13, arg6=number_14, lacing=Longest)
daylighting_environment = MakeDaylightingEnvironmentData(daylighting_skymodel, number_11, number_12, dateTime, lacing=Longest)
cloud_daylighting_job = CloudDaylightingJob(string, number, number, XYZ, XYZ_2, XYZ_3, daylighting_environment, lacing=Longest)
boolean = BoolSelector(false)
cloud_render = CloudRender(upload_render_data, cloud_daylighting_job, boolean)
parse_daylighting_file = ParseSDF(cloud_render, lacing=Longest)
number_15 = DoubleInput(0)
get_daylighting_grid_image = GetDaylightingForegroundImage(parse_daylighting_file, number_15, lacing=Longest)
# note: Parse various data from the returned rendering file
first_of_list = First(get_daylighting_grid_image)
watch_image = WatchImage(first_of_list)
select_face = FormElementBySelection()  # 1 picked in the model
watch_3d = Watch3D(select_face)
get_daylighting_grid_positions = GetDaylightingPositions(parse_daylighting_file, number_15, lacing=Longest)
first_of_list_2 = First(get_daylighting_grid_positions)
get_daylighting_grid_illuminance = GetDaylightingIlluminanceValues(parse_daylighting_file, number_15, lacing=Longest)  # "Get Daylighting Grid Illuminance Values"
first_of_list_3 = First(get_daylighting_grid_illuminance)
illuminance_to_srgb = IlluminanceToSRGB(first_of_list_3, lacing=Longest)
# note: using the floor of the revit model, and our (xyz points, illuminance data) plot the data onto the floor.  This will show in the revit model.
display_lighting_data_on_surface = Custom[Display Lighting Data On Surface](face=select_face, xyz_sample_points=first_of_list_2, data=illuminance_to_srgb)  # projects xyz positions to face and draws sample data there - requires setting up an analysis display style in revit proejct and using a transaction after this node.
transaction_2 = Transaction(display_lighting_data_on_surface)
