# Dynamo graph Simple Cloud Render.dyn (Dynamo 0.6.3.30451)

# note: when hitting run render will upload and take a few minutes to return - run button will grey out - check the console for progress
string = StringInput("{3D}")
export_render_data = ExportDocumentRenderData(string)
upload_render_data = UploadRenderData(export_render_data)
number = DoubleInput(640)
number_2 = DoubleInput(480)
render_type = RenderType(index=4)
render_quality = RenderQuality(index=3)
cloud_rendering_job = CloudRenderingJob(string, number, number_2, render_type, render_quality, lacing=Longest)
boolean = BoolSelector(false)
cloud_render = CloudRender(upload_render_data, cloud_rendering_job, boolean)
first_of_list = First(cloud_render)
read_image_file = ImageFileReader(first_of_list, number, number_2)
