# Dynamo graph hill_climbing_simple.dyn (Dynamo 0.6.3.30451)

number = DoubleInput(100)
# note: THIS IS THE GOAL POINT - how we evaluate fitness is distance to this point
XYZ = Xyz(number, number, number, lacing=Longest)
random_number = Random()
# note: generate the first random parent
multiply = Multiplication(random_number, number, lacing=Longest)
XYZ_2 = Xyz(multiply, multiply, multiply, lacing=Longest)
# note: This is the first parent fitness, we use distance here as a literal distance metric
xyz_distance = XyzDistance(XYZ, XYZ_2, lacing=Longest)
# note: This is the altered child - by adding a new vector - this is also a recursive node
produceChild = Custom[ProduceChild](parent_xyz=XYZ_2, goal_xyz=XYZ)
