# Dynamo graph ImportExport_CSV to Stuff.dyn (Dynamo 0.7.2.2921)

# note: Browse a CSV file that has numbers
# in x, y, and z coordinate space
file_path = Filename("C:\ProgramData\Dynamo\0.7\samples\ImportExport\helix.csv")
fromPath = FileObject(file_path)  # "File.FromPath"
readText = File.ReadText(fromPath)
string = StringInput("\n")
# note: Split the String on
# A carriage return <enter>
split = String.Split(readText, string)
string_2 = StringInput(",")
# note: Split the String on Comma
split_2 = String.Split(split, string_2)
# note: CSV files supply Strings, not numbers
toNumber = String.ToNumber(split_2)
# note: Group X, Y, & Z components
transpose = List.Transpose(toNumber)
firstItem = List.FirstItem(transpose)
code_block = CodeBlock { 1; }
getItemAtIndex = List.GetItemAtIndex(transpose, code_block)
lastItem = List.LastItem(transpose)
byCoordinates = Point.ByCoordinates(firstItem, getItemAtIndex, lastItem)
double_slider = DoubleSlider(2.337, range=0..20)
# note: Adjust the overall distribution
# of the coordinate points
scale = Geometry.Scale(byCoordinates, double_slider, lacing=Longest)
