# Dynamo graph ImportExport_Data To Excel.dyn (Dynamo 0.7.2.2921)

file_path = Filename("C:\ProgramData\Dynamo\0.7\samples\ImportExport\points")
string = StringInput("helix")
number = DoubleInput(0)
number_of_rotations = DoubleSlider(1.793, range=0..5)
code_block = CodeBlock(numCircles=number_of_rotations) { 0..(360*numCircles)..10; }
cos = Math.Cos(code_block, lacing=Longest)
sin = Math.Sin(code_block, lacing=Longest)
code_block_2 = CodeBlock(x=code_block) { x/100; }
byCoordinates = Point.ByCoordinates(cos, sin, code_block_2, lacing=Longest)
code_block_3 = CodeBlock(pt=byCoordinates) { {pt.X,pt.Y,pt.Z}; }
transpose = List.Transpose(code_block_3)
writeToFile = Excel.WriteToFile(file_path, string, number, number, transpose)
