# Dynamo graph ImportExport_Excel to Dynamo.dyn (Dynamo 0.7.2.2921)

file_path = Filename("C:\ProgramData\Dynamo\0.7\samples\ImportExport\helix.xlsx")
fromPath = FileObject(file_path)  # "File.FromPath"
string = StringInput("helix")
readFromFile = Excel.ReadFromFile(fromPath, string)
transpose = List.Transpose(readFromFile)
number = DoubleInput(0)
getItemAtIndex = List.GetItemAtIndex(transpose, number)
number_2 = DoubleInput(1)
getItemAtIndex_2 = List.GetItemAtIndex(transpose, number_2)
number_3 = DoubleInput(2)
getItemAtIndex_3 = List.GetItemAtIndex(transpose, number_3)
byCoordinates = Point.ByCoordinates(getItemAtIndex, getItemAtIndex_2, getItemAtIndex_3, lacing=Longest)
