# Dynamo graph Revit_Floors and Framing.dyn (Dynamo 0.7.0.42482)

# note: Center Of Folly
# note: Run this graph the DynamoSample.rvt file in the Samples folder located with your Dynamo installation
# C:\ProgramData\Dynamo\0.7\samples\Revit
# note: This definition creates an architectural folly, using a series of lines and uses them to drive the placement of Structural Framing and Floors.
number = DoubleInput(15)
number_2 = DoubleInput(-10)
number_3 = DoubleInput(-0.25)
byCoordinates = Point.ByCoordinates(number, number_2, number_3)
# note: Floor Heights
number_4 = DoubleInput(5)
number_5 = DoubleInput(-0.75)
number_sequence = NumberSeq(number_4, number_4, number_5, lacing=Longest)
# note: Make a bunch of polygons
byCenterPointRadius = Circle.ByCenterPointRadius(byCoordinates, number_sequence)
number_6 = DoubleInput(5)
regularPolygon = Polygon.RegularPolygon(byCenterPointRadius, number_6)
number_7 = DoubleInput(0)
code_block = CodeBlock(x=number_4) { 0..20..#x; }
byCoordinates_2 = Vector.ByCoordinates(number_7, number_7, code_block)
# note: Move the Polygons up and rotate
translate = Geometry.Translate(regularPolygon, byCoordinates_2)
ZAxis = Vector.ZAxis()
code_block_2 = CodeBlock(count=number_4) { 0..45..#count; }
rotate = Geometry.Rotate(translate, byCoordinates, ZAxis, code_block_2)
# note: Extract individual curves from the polygons
curves = PolyCurve.Curves(rotate)
floor_types = FloorTypes(index=3)
levels = Levels(index=1)
# note: Pass Groups of Curves to create Floors
byOutlineTypeAndLevel = Floor.ByOutlineTypeAndLevel(curves, floor_types, levels)
endPoint = Curve.EndPoint(curves)
# note: Connect up matching edges of polygons to create supports
transpose = List.Transpose(endPoint)
byPoints = PolyCurve.ByPoints(transpose)
curves_2 = PolyCurve.Curves(byPoints)
levels_2 = Levels(index=3)
ZAxis_2 = Vector.ZAxis()
beam = StructuralType.Beam()
structural_framing_types = StructuralFramingTypes(index=1)
# note: Pass individual curves for each structural element
byCurveLevelUpVectorAndType = StructuralFraming.ByCurveLevelUpVectorAndType(curves_2, levels_2, ZAxis_2, beam, structural_framing_types)
