# Dynamo graph Revit_PlaceFamiliesByLevel_Set Parameters.dyn (Dynamo 0.7.0.42482)

# note: Run this graph the DynamoSample.rvt file in the Samples folder located with your Dynamo installation
# C:\ProgramData\Dynamo\0.7\samples\Revit
# note: Place a number of Solar panels and write unique numbers to their Mark Parameter
family_types = FamilyTypes(index=41)
code_block = CodeBlock { -10; 10; 2.5; }
number_range = NumberRange(code_block.out0, code_block.out1, code_block.out2, lacing=Longest)
code_block_2 = CodeBlock { -10..-15..#3; }
byCoordinates = Point.ByCoordinates(number_range, code_block_2, lacing=CrossProduct)
flatten = Flatten(byCoordinates)
levels = Levels(index=3)
# note: Place Family Instances
# Most Families Can also be placed by Point location.  Adaptive Components can be placed with multiple points, Structural Framing is placed with Curves
byPointAndLevel = FamilyInstance.ByPointAndLevel(family_types, flatten, levels)
string = StringInput("Mark")
number = DoubleInput(1)
count = Count(byPointAndLevel)
number_sequence = NumberSeq(number, count, number, lacing=Longest)
fromObject = String.FromObject(number_sequence)
# note: Set each Family instance parameter.  Using the same model, parameters can also be read, using an Element.GetParameterByName
setParameterByName = Element.SetParameterByName(byPointAndLevel, string, fromObject)
