# Dynamo graph Revit_StructuralFraming.dyn (Dynamo 0.7.5.3267)

# note: Run this graph the DynamoSample.rvt file in the Samples folder located with your Dynamo installation
# C:\ProgramData\Dynamo\0.7\samples\Revit
# note: Place Structural Framing Relative to some elements selected from a Revit file
select_model_element = DSModelElementSelection()  # 1 picked in the model
geometry = Element.Geometry(select_model_element)
integer_slider = IntegerSlider(9, range=2..10)
code_block = CodeBlock(x=integer_slider) { 0..1..#x; }
pointAtParameter = Curve.PointAtParameter(geometry, code_block, lacing=CrossProduct)
# note: Model Curves have been selected and their element IDs saved with this file
select_model_element_2 = DSModelElementSelection()  # 1 picked in the model
# note: Geometry is Seperated from Revit Elements
geometry_2 = Element.Geometry(select_model_element_2)
# note: Create Points along the Lines
pointAtParameter_2 = Curve.PointAtParameter(geometry_2, code_block, lacing=CrossProduct)
byStartPointEndPoint = Line.ByStartPointEndPoint(pointAtParameter, pointAtParameter_2)
flatten = Flatten(byStartPointEndPoint)
levels = Levels("Ceiling")
ZAxis = Vector.ZAxis()
beam = StructuralType.Beam()
structural_framing_types = StructuralFramingTypes("1 3/4x14")
# note: Place Structural Framing
byCurveLevelUpVectorAndType = StructuralFraming.ByCurveLevelUpVectorAndType(flatten, levels, ZAxis, beam, structural_framing_types)
