# Dynamo graph Basics_Basic01.dyn (Dynamo 2.19.3.6543)
# author: Dynamo Team
# Propojit uzly k přidání dvou čísel

# note: Základní funkční vstupy, například čísla a řetězce, je možné vybrat buď procházením, nebo vyhledáním v knihovně na levé straně kreslicí plochy.
# V knihovně rovněž naleznete operace, které lze s daty provádět, například matematické nebo geometrické transformace.
# note: Aplikace Dynamo je vizuální programovací jazyk. Podobně jako jiné jazyky funguje na principu spojování jednoduchých prvků za účelem vytvoření složitějších konceptů.
# note: Vytáhněte konektor ven z portu „>“ na uzlu Number a připojte jej k portu „Y“ na uzlu +, pak stiskněte tlačítko „Spustit“ v levém dolním rohu aplikace.
number = DoubleInput(2)  # graph input
add = number + _  # unwired: y
# note: Data je možné vizualizovat kliknutím na tlačítko Spustit v pravém dolním rohu aplikace. Pokud zapnete režim spuštění „Automaticky“, aplikace se bude stále aktualizovat.
# Data je možné zobrazit buď pomocí uzlu Watch, nebo kliknutím na malý čtvereček v dolní části většiny uzlů.
watch = Watch(add)
# note: Další ukázkové soubory lze nalézt v nabídce Nápověda, nebo se zavřením tohoto souboru pomocí kliknutí na symbol „X“ na kartě vraťte na úvodní stránku.
number_2 = DoubleInput(6)  # graph input
