# Dynamo graph Basics_Basic02.dyn (Dynamo 2.19.3.6543)
# author: Dynamo Team
# Vytvořit úsečku spojením dvou bodů

# note: Manipulace s polohou bodu v prostředí aplikace Dynamo: Vyberte uzel Point.ByCoordinates a přepněte do náhledu pozadí, abyste mohli táhnout bod podél jeho tří os.
byCoordinates = Point.ByCoordinates()
# note: Geometrická data lze zobrazit buď jako textové informace, nebo v 3D prostoru.
watch = Watch(byCoordinates)
number = DoubleInput(2)  # graph input
# note: Pomocí uzlů Number Slider nebo Integer Slider můžete dynamicky zadávat hodnotu v zadaném rozsahu. Kliknutím na modrou rozevírací šipku otevřete nastavení číselného rozsahu
number_slider = DoubleSlider(4.43, range=0..10 step 0.1)  # graph input
# note: Můžete přepínat mezi 3D navigací na pozadí a navigací v pohledu grafu, a to pomocí tlačítek v pravém horním rohu obrazovky (klávesová zkratka Ctrl+B). Možnost Náhled pozadí je v aplikacích Dynamo a Revit také možné zapnout v nabídce Zobrazit.
byCoordinates_2 = Point.ByCoordinates(x=number, z=number_slider)
byStartPointEndPoint = Line.ByStartPointEndPoint(startPoint=byCoordinates_2, endPoint=byCoordinates)
# note: Pomocí uzlu Watch 3D můžete vizualizovat 3D prvek samostatně.
watch_3d = Watch3D(byStartPointEndPoint)
