# Dynamo graph Basics_Basic03.dyn (Dynamo 2.19.3.6543)
# author: Dynamo Team
# Vytvořit jednoduchý seznam

# group: Vstupy
# note: Seznamy dat mohou být vygenerovány společně s posloupnostmi a rozsahy. Tyto seznamy je možné znovu uspořádat pomocí mnoha dalších uzlů ke specifickým účelům
number = DoubleInput(0)  # graph input
number_2 = DoubleInput(9)  # graph input
number_3 = DoubleInput(1)  # graph input

# note: Vytvořte posloupnost čísel od Start po End s danou hodnotou Step
range = Range(start=number, end=number_2, step=number_3, lacing=Longest)
watch = Watch(range)
number_4 = DoubleInput(3)  # graph input
# note: Rozdělit seznam na seznamy o délkách 3
chop = List.Chop(list=range, lengths=number_4)
# note: Zobrazit náhled výsledku a sledovat strukturu seznamu pomocí uzlu Watch
watch_2 = Watch(chop)
# note: Získat poslední položku v seznamu
lastItem = List.LastItem(list=range)
watch_3 = Watch(lastItem)
