# Dynamo graph Core_AttractorPoint.dyn (Dynamo 3.0.0.6964)
# author: Dynamo Team
# Tento graf vytváří osnovu válců, kde jsou velikosti určeny pozicí bodu atraktoru.

# group: Info
# note: BOD ATRAKTORU
# Bod atraktoru je referenční bod (nebo prvek), který ovlivňuje vlastnosti jiných prvků v systému. Bod atraktoru často funguje jako magnet – čím blíže je prvek k atraktoru tím více je ovlivněn vlivem atraktoru.
# V tomto příkladu jsou výška a průměr válců určeny vzdáleností mezi každým válcem a bodem atraktoru, který se pohybuje. Válce kolem bodu atraktoru jsou menší než válce, které jsou dál.
# Chcete-li toto chování vizualizovat, pohybujte se dvěma posuvníky vstupu bodu atraktoru.
# Body atraktoru představují způsob, jak do procesu návrhu zavést úroveň responzivity a dynamického chování.

# group: Velikost osnovy bodů
# note: Pomocí uzlu Code Block vytvořte posloupnost čísel. V tomto příkladu se vytvoří posloupnost s čísly od 1 do 50, s n kroky, kde každý krok je 5.
rozsah_čísel = CodeBlock { 1..50..5; }

# group: Vytvořit osnovu bodů
# note: Osnova bodů.
# Chcete-li vytvořit tento prvek, předejte řadu čísel do dvou portů – souřadnic X a Y. Klikněte pravým tlačítkem na uzel a změňte možnost Vázání na hodnotu „Kartézský součin“.
# note: Vázání kartézským součinem kombinuje jednotlivé položky z jednoho seznamu s každou položkou ve všech ostatních seznamech, což vytvoří strukturu seznamů podobnou osnově.
# Pokud se tato metoda použije u vstupů X a Y uzlu 'Point.ByCoordinates' je výsledkem plochá osnova bodů. Pokud je použita třetí souřadnice Z, je výsledkem osnova bodů ve tvaru krychle.
byCoordinates = Point.ByCoordinates(x=rozsah_čísel, y=rozsah_čísel, lacing=CrossProduct)

# group: Vyrovnání struktury seznamu
# Složitá struktura seznamu není vyžadována pro další akce s body. Chcete-li vytvořit pouze jeden seznam, použijte příkaz Flatten.
# note: Vyrovnejte seznam, protože hierarchie řádků a sloupců není potřeba. Porovnejte vstup do tohoto uzlu s výstupem – struktura N seznamů se změnila pouze na pouze jeden seznam.
flatten = List.Flatten(list=byCoordinates)

# group: Pozice bodu atraktoru
number_slider = DoubleSlider(24.6, range=-10..60 step 0.1)  # graph input
number_slider_2 = DoubleSlider(11.50111001, range=-10..60 step 0.1)  # graph input
# note: Bod atraktoru. Přesunutím posuvníků vstupu upravte umístění tohoto bodu.
byCoordinates_2 = Point.ByCoordinates(x=number_slider, y=number_slider_2)

# group: Vzdálenost k atraktoru
# note: Najde vzdálenost mezi bodem atraktoru a každým základním bodem válců
distanceTo = Geometry.DistanceTo(geometry=flatten, other=byCoordinates_2)

# group: Generovat poloměry a výšky
# note: Vzorec, který zajistí, aby výška válce reagovala na umístění bodu atraktoru. V tomto příkladu je výška každého válce polovina vzdálenosti od bodu atraktoru. Zkuste použít jiný vzorec.
výška_válce = CodeBlock(x=distanceTo) { x/2; }
# note: Vzorec vrací hodnotu, která se použije jako poloměr válce. Čím větší je vzdálenost, tím větší je poloměr každého válce. Zkuste použít jiný vzorec.
poloměr_válce = CodeBlock(x=distanceTo) { x/15; }

# group: Koncové body
# Posune počáteční (původní) bod každého válce s danou výškou definovanou vzorcem
# note: Vektor, který popisuje posun základního (původního) bodu nahoru o zadanou hodnotu
byCoordinates_3 = Vector.ByCoordinates(z=výška_válce)
# note: Přidejte tuto novou hodnotu Z (výšku) k původním bodům osnovy, abyste získali horní body válců.
add = Point.Add(point=flatten, vectorToAdd=byCoordinates_3)

# group: Vytvořit válce
# note: Použijte metodu, která vytvoří válec s daným počátečním a koncovým bodem a daným poloměrem
byPointsRadius = Cylinder.ByPointsRadius(startPoint=flatten, endPoint=add, radius=poloměr_válce)
