# Dynamo graph Core_CodeBlocks.dyn (Dynamo 3.4.1.7055)
# author: Dynamo Team
# Tento graf zkoumá různá použití uzlů Code Block

# group: Info
# note: BLOKY KÓDU
# Bloky kódu je možné vytvořit dvojitým kliknutím na kreslicí plochu. Uzel Code Block je také možné najít v knihovně uzlů pod položkou Script > Editor.
# Bloky kódu mohou obsahovat:
# •   číselné hodnoty (celá čísla a čísla s plovoucí desetinnou čárkou),
# •   řetězce (text),
# •  booleovské hodnoty (True nebo False),
# •  seznamy [0,1,2],
# •  výrazy (a+3),
# •  proměnné,
# Jiné uzly je možné transformovat do výrazu bloku kódu: vyberte jeden nebo více uzlů, klikněte pravým tlačítkem do prostoru mezi uzly a vyberte možnost 'Uzel do kódu'. Neexistuje žádný zpětný ekvivalent této akce – bloky kódu není možné automaticky převést na uzly.

# group: Uzly jako bloky kódu
# note: Bloky kódu je možné použít k volání libovolného jiného uzlu v knihovně. Uzly v knihovně mají obvykle tři typy:
#     Vytvořit:	něco vytvořit
#     Akce:		provést akci na něčem
#     Dotaz:		získat vlastnost něčeho
# 		co již existuje
# S metodami nebo uzly těchto tří typů se při spuštění v bloku kódu zachází různě.

# group: Tvorba geometrie
# note: Společně tyto příkazy formují algoritmus, který vytvoří spirálovitou křivku základního bodu.
code_block = CodeBlock()
# ---------- code_block.designscript (16 lines) ----------
// Basic inputs
base = Point.ByCoordinates(3,3);
coils = 3;
height = 5;
rad = 0.5;

// Make a series of points
numPts = 8*coils + 1;
seq = 0..(coils*360)..#numPts;
x = rad * Math.Cos(seq);
y = rad * Math.Sin(seq);
z = 0..height..#numPts;
pts = Point.ByCoordinates(x + base.X, y + base.Y, z + base.Z);

// Pass a curve through those points
NurbsCurve.ByPoints(pts);
# ----------------------------------------
# note: Algoritmus šroubovice je převeden na funkci pomocí pojmenování, určení vstupů a informování, co má vracet.
code_block_2 = CodeBlock()
# ---------- code_block_2.designscript (13 lines) ----------
def MakeSpring(base,coils,height,rad)
{
// Make a series of points
numPts = 8*coils + 1;
seq = 0..(coils*360)..#numPts;
x = rad * Math.Cos(seq);
y = rad * Math.Sin(seq);
z = 0..height..#numPts;
pts = Point.ByCoordinates(x + base.X, y + base.Y, z + base.Z);

// Return the curve that passes through those points
return = NurbsCurve.ByPoints(pts);
};
# ----------------------------------------
code_block_3 = CodeBlock { 0..6..2; }
code_block_4 = CodeBlock { 10..20..2; }
# note: Algoritmus šroubovice je převeden tak, aby definoval funkci s libovolným názvem „MakeSpring“. Tato funkce se volá za účelem vytvoření několika pružin s náhodnými výškami uspořádaných v rastru.
# note: Vytvoří osnovu.
byCoordinates = Point.ByCoordinates(x=code_block_3, y=code_block_4, lacing=CrossProduct)
flatten = List.Flatten(list=byCoordinates)
code_block_5 = CodeBlock { 5; }
count = List.Count(list=flatten)
# note: Vytvoří posloupnost náhodných čísel (se změnou měřítka o 5) pro výšky pružin.
randomList = Math.RandomList(amount=count)
code_block_6 = CodeBlock(random=randomList) { random * 5; }
# note: Vstupy k volání funkcí lze vytvořit pomocí seznamů položek nebo položek s jednou hodnotou. Data mohou být předána přes port nebo deklarována přímo, jako v případě hodnoty „0.5“ pro poloměr všech pružin.
code_block_7 = CodeBlock(basePoints=flatten, numCoils=code_block_5, height=code_block_6) { MakeSpring(basePoints,numCoils,height,0.5); }

# group: Funkce
# note: Funkce mohou být definovány přímo v uzlu Code Block, který bude volán jinde v této definici.
# První řádek obsahuje klíčové slovo „def“, pak název funkce a potom vstupy v závorkách.
# Složené závorky definují text funkce. Každý řádek musí končit středníkem.
# Hodnota je vrácena takto: „return =“.
code_block_8 = CodeBlock()
# ---------- code_block_8.designscript (11 lines) ----------
/* This is a multi-line comment,
     which continues for mulitple
     lines. */

def FunctionName(input1, input2)
{
// This is a comment
sum = input1 + input2;

return = sum;
};
# ----------------------------------------
code_block_9 = CodeBlock { 1; }
# note: Uzly Code Block, které definují funkci, nemají vstupní nebo výstupní porty, protože se volají z jiných uzlů Code Block.
code_block_10 = CodeBlock { 2; }
# note: Volejte funkci s jiným uzlem Code Block ve stejném souboru, a to poskytnutím stejného názvu a stejného počtu argumentů.
code_block_11 = CodeBlock(in1=code_block_9, in2=code_block_10) { FunctionName(in1,in2); }
watch = Watch(code_block_11)
code_block_12 = CodeBlock { "cat"; }
code_block_13 = CodeBlock { "dog"; }
# note: Typ vstupních argumentů není určen v definici funkce, takže bude fungovat podle toho, jaký přijme.
code_block_14 = CodeBlock(in1=code_block_12, in2=code_block_13) { FunctionName(in1,in2); }
watch_2 = Watch(code_block_14)
origin = Point.Origin()
code_block_15 = CodeBlock { 16; }
# note: Volání funkce se vstupy, které nemají pro danou funkci smysl, bude mít za následek výsledek null.
code_block_16 = CodeBlock(in1=origin, in2=code_block_15) { FunctionName(in1,in2); }
watch_3 = Watch(code_block_16)

# group: Číselné hodnoty
# Porovná účelové uzly s uzlem Code Block
# note: Účelové
number = DoubleInput(3.14)
výsledek = Watch(number)
# note: Code Block
code_block_17 = CodeBlock { 3.140; }
watch_4 = Watch(code_block_17)

# group: Řetězcové hodnoty
# Porovnat účelové uzly s uzlem Code Block
# note: Účelové
string = StringInput("Less is more.")
výsledek_2 = Watch(string)
# note: Použijte uvozovky "" k vytvoření řetězce s uzlem Code Block
code_block_18 = CodeBlock { "Less is more."; }
watch_5 = Watch(code_block_18)
# note: Pomocí tohoto uzlu zobrazíte typ výstupní hodnoty.
type = Object.Type(object=code_block_18)
watch_6 = Watch(type)

# group: Výrazy
# Provede operace násobení pomocí účelového uzlu * a pomocí uzlu Code Block
number_2 = DoubleInput(3)
number_3 = DoubleInput(5)
# note: Vynásobí dvě čísla pomocí uzlu *.
mul = number_2 * number_3
výsledek_3 = Watch(mul)
# note: Provede násobení pomocí uzlu Code Block
code_block_19 = CodeBlock { 3*5; }
watch_7 = Watch(code_block_19)
code_block_20 = CodeBlock { 3; }
code_block_21 = CodeBlock { 5; }
# note: Použijte proměnné jako vstupy pro operaci násobení.
code_block_22 = CodeBlock(a=code_block_20, b=code_block_21) { a*b; }
watch_8 = Watch(code_block_22)

# group: Dotaz
# Metody, které dotazují a vrací vlastnost objektu
# note: Pomocí bloků kódu se uživatel může rozhodnout, jak určit vstupy. Zde je například několik různých způsobů, jak vytvořit stejný bod.
code_block_23 = CodeBlock { 10; }
code_block_24 = CodeBlock { -10; }
# note: Přednastavená metoda používající uzel Point.ByCoordinates
byCoordinates_2 = Point.ByCoordinates(x=code_block_23, y=code_block_24)
watch_9 = Watch(byCoordinates_2)
# note: Blok kódu používá metodu Point.ByCoordinates se třemi proměnnými pro souřadnice X, Y a Z, kde hodnota Z je definována v rámci stejného bloku kódu a je oddělena středníkem (;).
code_block_25 = CodeBlock(x=code_block_23, y=code_block_24) { z = 0; Point.ByCoordinates(x,y,z); }
watch_10 = Watch(code_block_25.out1)
code_block_26 = CodeBlock { Point.ByCoordinates(10,0,0); }
# note: ekvivalent bloku kódu stejné metody. Metody dotazu nevyžadují žádné závorky
code_block_27 = CodeBlock(pt=code_block_26) { pt.X; }
watch_11 = Watch(code_block_27)
# note: Přednastavená metoda dotazu, která vrací souřadnici X bodu
X = Point.X(point=code_block_26)
watch_12 = Watch(X)
# note: Vzorec použití záporné hodnoty stejné číselné hodnoty je zde integrován do zápisu vstupních proměnných
code_block_28 = CodeBlock(num=code_block_23) { Point.ByCoordinates(num,-num,0); }
watch_13 = Watch(code_block_28)
# note: Blok kódu používá metodu Point.ByCoordinates, všechny tři proměnné jsou zadány jako vstup
code_block_29 = CodeBlock { Point.ByCoordinates(10,-10,0); }
watch_14 = Watch(code_block_29)

# group: Vytvořit
# Metody, které tvoří geometrii, seznamy, prvky aplikace Revit nebo jiné objekty
# note: Přednastavená metoda tvorby bodu v počátku
origin_2 = Point.Origin()
watch_15 = Watch(origin_2)
# note: Ačkoliv tato metoda nevyžaduje žádné vstupy, závorky jsou povinné
code_block_30 = CodeBlock { Point.Origin(); }
watch_16 = Watch(code_block_30)
code_block_31 = CodeBlock { 0; -10; }
# note: Přednastavená metoda tvorby bodu pomocí zadání souřadnic X a Y
byCoordinates_3 = Point.ByCoordinates(x=code_block_31.out0, y=code_block_31.out1)
watch_17 = Watch(byCoordinates_3)
# note: Pomocí uzlu Code Block replikujte chování uzlu Point.ByCoordinates. Název metody najdete, pokud umístíte kurzor myši nad původní přednastavený uzel: metoda je uvedena v dolní části okna popisku nástroje.
# Vstupy je nutné zadat v pořadí, v jakém byly v přednastaveném uzlu uvedeny.
code_block_32 = CodeBlock { Point.ByCoordinates(0,-10); }
watch_18 = Watch(code_block_32)

# group: Akce
# Metody, které provádějí akci na objektu
origin_3 = Point.Origin()
ZAxis = Vector.ZAxis()
# note: Přednastavená metoda přidávání vektoru do bodu
add = Point.Add(point=origin_3, vectorToAdd=ZAxis)
watch_19 = Watch(add)
origin_4 = Point.Origin()
ZAxis_2 = Vector.ZAxis()
# note: Na objektu jsou provedeny metody akce. Použijte tečkovou notaci za samotným objektem a určete metodu a všechny vstupy uvedené na přednastaveném uzlu kromě prvního (protože první vstupní port je samotný objekt, který již máte!)
code_block_33 = CodeBlock(pt=origin_4, vector=ZAxis_2) { pt.Add(vector); }
watch_20 = Watch(code_block_33)

# group: Vytvořit seznamy
# note: Vytvoří seznamy pomocí hranatých závorek (definují samotný seznam) a čárek, kterými se oddělí jednotlivé prvky
code_block_34 = CodeBlock { ["San Francisco","New York","Chicago"]; }
watch_21 = Watch(code_block_34)
# note: Získá položky v seznamu pomocí následujícího zápisu: seznam [ i ], kde i je index položky. Tato metoda je identická s použitím uzlu GetItemAtIndex.
code_block_35 = CodeBlock(cities=watch_21) { cities[2]; }
watch_22 = Watch(code_block_35)
# note: V tomto bloku kódu je definováno více proměnných a nakonec se vytvoří seznam, který obsahuje všechny z nich.
code_block_36 = CodeBlock()
# ---------- code_block_36.designscript (7 lines) ----------
str0 = "alpha";
str1 = "beta";
str2 = "charlie";
str3 = "delta";
str4 = "echo";
//
[str0,str1,str2,str3,str4];
# ----------------------------------------
watch_23 = Watch(code_block_36.out5)
code_block_37 = CodeBlock(phonetic=watch_23) { phonetic[2..3]; }
watch_24 = Watch(code_block_37)
code_block_38 = CodeBlock { 2; }
getItemAtIndex = List.GetItemAtIndex(list=watch_21, index=code_block_38)
watch_25 = Watch(getItemAtIndex)

# group: Kombinuje seznamy a získá přístup k položkám seznamu
# Popis <Dvojitým kliknutím sem upravte popis skupiny>
# note: Vytvořte vnořené seznamy a načtěte položky z vnořených seznamů.
code_block_39 = CodeBlock()
# ---------- code_block_39.designscript (6 lines) ----------
kitchen = ["table","stove","sink","refrigerator"];
livingRoom = ["sofa","books"];
bedroom = ["bed","dirty clothes"];
bathroom = ["tooth brush"];
//
allMyStuff = [kitchen, livingRoom, bedroom, bathroom];
# ----------------------------------------
watch_26 = Watch(code_block_39.allMyStuff)
# note: Získá přístup k druhé položce v třetím seznamu (nebo jinými slovy získá přístup k položce s indexem '1' v seznamu s indexem '2')
code_block_40 = CodeBlock(list=watch_26) { list[2][1]; }
watch_27 = Watch(code_block_40)

# group: Replikace
# note: Vodítka replikace lze použít k určení, aby byly seznamy vázány jako „kartézský součin“.
code_block_41 = CodeBlock { x_vals = 0..10; y_vals = -30..-40; }
code_block_42 = CodeBlock(x_vals=code_block_41.x_vals, y_vals=code_block_41.y_vals) { Point.ByCoordinates(x_vals, y_vals); }
code_block_43 = CodeBlock { x_vals = 0..10; y_vals = -15..-25; }
code_block_44 = CodeBlock(x_vals=code_block_43.x_vals, y_vals=code_block_43.y_vals) { Point.ByCoordinates(x_vals<1>, y_vals<2>); }
byCoordinates_4 = Point.ByCoordinates(x=code_block_41.x_vals, y=code_block_41.y_vals)
byCoordinates_5 = Point.ByCoordinates(x=code_block_43.x_vals, y=code_block_43.y_vals, lacing=CrossProduct)
# note: Vodítka replikace, která využívají lomené závorky, berou dvě nebo tři jednorozměrné kolekce a párují prvky dohromady za účelem vytvoření jedno-, dvoj- nebo trojrozměrné kolekce.
# note: V tomto příkladu jsou 2 hodnoty X a 5 hodnot Y. Vodítka replikace mohou určit, že výslednou kombinací budou 2 seznamy 5 bodů nebo 5 seznamů 2 bodů.
code_block_45 = CodeBlock()
# ---------- code_block_45.designscript (5 lines) ----------
x_vals = 0..1;
y_vals = -3..-7;
//
Point.ByCoordinates(x_vals<1>, y_vals<2>);
Point.ByCoordinates(x_vals<2>, y_vals<1>);
# ----------------------------------------
watch_28 = Watch(code_block_45.out2)
watch_29 = Watch(code_block_45.out3)

# group: Booleovský
# Porovná účelové uzly pomocí uzlu Code Block
# note: Uzel přepínače booleovské hodnoty.
boolean = BoolSelector(true)
watch_30 = Watch(boolean)
# note: použijte hodnoty 'true' nebo 'false' v uzlu Code Block k vyjádření týchž hodnot
code_block_46 = CodeBlock { true; }
watch_31 = Watch(code_block_46)
