# Dynamo graph Core_ListAtLevel.dyn (Dynamo 3.1.0.3411)
# author: Dynamo Team
# Prozkoumáme funkci List@Level a jak s její pomocí můžeme dosáhnout stejných výsledků jako s uzlem List.Map. Vytvoříme řadu panelů, pomocí nichž demonstrujeme, jak funkce List@Level vlastně funguje.

# group: Info
# note: Chcete-li určit, se kterou úrovní seznamu chcete pracovat, podívejte se do dolní části náhledu nebo uzlu sledování a postupujte podle řádků zápisu funkce List@Level směrem nahoru.

# group: Info
# Obecné informace o používání funkce List@Level
# note: LIST@LEVEL
# Funkce List@Level nahrazuje funkci List.Map tím, že vám umožní vybrat přímo úroveň seznamu, se kterou chcete pracovat.
# note: Chcete-li změnit úroveň seznamu, se kterou pracujete, klikněte na šipku vedle seznamu vstupního portu a povolte možnost „Použít úrovně“.
# Když se na vstupním portu nejprve povolí funkce List@Level, vybere se pro práci seznam na druhé nejvnitřnější úrovni (L2).

# group: Info
# Jak tento graf funguje
# note: Chceme vytvořit panely na vnitřní straně osnovy. K tomu je nutné získat body na indexech 1 a 2 z každého seznamu na nejvnitřnější úrovni. To lze snadno provést pomocí funkce List@Level. Seskupení seznamů se uchovávají povolením možnosti „Zachovat strukturu seznamu". Nejprve si však lépe prohlédneme seznam, který jsme vytvořili pomocí konstruktoru Point.ByCoordinates, abychom určili, kterou úroveň seznamu chceme použít.

# group: Vstupy
# Popis <Dvojitým kliknutím sem upravte popis skupiny>
code_block = CodeBlock { 0..30..#8; 12..0..#4; }
# note: V tomto příkladu vytvoříme 3D seznam obsahující řadu bodů. Na úrovni L3 je 8 seznamů a každý seznam obsahuje další 4 seznamy (L2). Každý ze 4 seznamů obsahuje čtyři body (L1), což je celkově 128 bodů.
byCoordinates = Point.ByCoordinates(x=code_block.out0, y=code_block.out1, z=code_block.out1, lacing=CrossProduct)

# group: Nahrazení funkce List.Map položkou List@Level
code_block_2 = CodeBlock { [1,2]; }
# note: V předchozí verzi aplikace Dynamo, se funkce List.Map používá k získání vnitřních úrovní seznamů. I když stejného výsledku lze dosáhnout pomocí List.Map, přináší do pracovního prostoru další uzly. Zde pomocí funkce List@Level zachytíme vnitřní body osnovy efektivněji. Pomocí těchto bodů následně vytvoříme požadované panely.
# Také jsme pomocí možnosti „Zachovat strukturu seznamu" zachovali seskupování počátečního seznamu a zabránili jeho vyrovnání. Pokud je možnost „Zachovat strukturu seznamu" vypnuta, vytvoří program jeden objekt NurbsSurface místo osmi.
getItemAtIndex = List.GetItemAtIndex(list=byCoordinates@@L2, index=code_block_2)
code_block_3 = CodeBlock { [1,2]; }
# note: Seznamy se nacházejí na různých úrovních, přičemž L1 je nejnižší úroveň. Celkový počet prvků vytvořených pomocí tohoto uzlu je 64 jako vidíte na obrázku vpravo dole.
getItemAtIndex_2 = List.GetItemAtIndex(index=code_block_3)  # unwired: list
# note: Níže je funkce List.Map použita jako ekvivalent funkce List@Level, která ovšem vyžaduje další uzly
map = List.Map(f_x=getItemAtIndex_2)  # unwired: list
map_2 = List.Map(list=byCoordinates, f_x=map)

# group: Vytvoření geometrie
# note: Nyní můžeme ze sady vybraných bodů vytvořit požadované panely.
byPoints = NurbsSurface.ByPoints(points=getItemAtIndex)
byBestFitThroughPoints = Line.ByBestFitThroughPoints(bestFitPoints=getItemAtIndex)

# group: Kontrola seznamu pomocí funkce List@Level a Count
# note: Uzel List.Count vrací počet prvků, které jsou přítomné v každém seznamu. V závislosti na vybraném podlaží vrací různé hodnoty. Zkuste změnit hodnotu L3 kliknutím na šipky vedle ní.
# note: Na úrovni L3 je osm seznamů, z nichž každý obsahuje další čtyři seznamy. Proto výběr L3 použije funkci List.Count na osm seznamů, dohromady osm hodnot '4'.
count = List.Count(list=byCoordinates@L3)

# group: Použití možnosti „Zachovat strukturu seznamu"
# note: Tento uzel vrací počet prvků, které jsou k přítomny v každém seznamu na úrovni L2. Ve výchozím nastavení se výsledky vyrovnají do 1D seznamu.
count_2 = List.Count(list=byCoordinates@L2)
# note: Chcete-li zachovat vnořenou struktura seznamů, vyberte možnost „Zachovat strukturu seznamu". Značka "@@" naznačuje, jak je možné zachovat strukturu seznamu v aplikaci DesignScript.
count_3 = List.Count(list=byCoordinates@@L2)

# group: Kontrola seznamu pomocí funkce List@Level a Flatten
# note: Jako další příklad můžete snadno vyrovnat vnořenou strukturu na vnitřních úrovních seznamů pomocí funkce List@Level a uzlu Flatten. Kliknutím na šipky u číselníku List@Level můžete měnit hladinu pro vyrovnání.
# note: Výběrem položky L3 převedete osm seznamů na této úrovni do 1D pole. Protože každý z těchto osmi seznamů obsahuje čtyři položky (které jsou také seznamy), budou tyto seznamy na L3 vyrovnány a vytvoří tak osm seznamů o 16 bodech.
flatten = List.Flatten(list=byCoordinates@L3)
