# Dynamo graph Core_ListLacing.dyn (Dynamo 3.1.0.3411)
# author: Dynamo Team
# Vázání seznamu – v tomto grafu jsou prozkoumány a demonstrovány všechny režimy vázání seznamu

# group: Info
# note: VÁZÁNÍ SEZNAMU
# Vázání je logika, kterou uzel aplikace Dynamo používá k porovnání položek z různých seznamů. Většina uzlů v aplikaci Dynamo vám umožňuje zvolit způsob kombinování seznamů informací pomocí nastavení „chování vázání“.
# Ve všech těchto příkladech existují dva seznamy bodů, které jsou předány do uzlu Line.ByStartPointEndPoint. Uzel, který tvoří čáru, musí rozhodnout, kolik čar vykreslit a mezi kterými množinami bodů.
# Nastavte chování vázání kliknutím pravým tlačítkem myši na uzel, který má dva nebo více vstupních portů, a výběrem položky „vázání“.

# group: Tip
# note: Tip: Zobrazte index položek jako popisek v náhledu na pozadí pro libovolný uzel, který tvoří geometrii. Klikněte pravým tlačítkem a vyberte možnost „Zobrazit popisky“.

# group: Tip
# note: Tip: Chování vázání uzlu je na uzlu označeno pomocí malého symbolu v pravém dolním rohu. Pokud nevidíte žádný symbol, uzel neprovádí vázání.

# group: Vstupy
# note: Delší řada (10 prvků)
code_block = CodeBlock { 0..9; }
code_block_2 = CodeBlock { 4; }
# note: Kratší řada (6 prvků)
code_block_3 = CodeBlock { 0..5; }
code_block_4 = CodeBlock { 0..9; }
code_block_5 = CodeBlock { -10; 4; }
code_block_6 = CodeBlock { 0..5; }
code_block_7 = CodeBlock { 0..9; }
code_block_8 = CodeBlock { 10; 4; }
code_block_9 = CodeBlock { 0..5; }

# group: Vytvořit body
# Vytvoří 2 sady bodů pro (10 x 6), které se použijí jako vstup pro uzel Line.ByStartPointEndPoint
byCoordinates = Point.ByCoordinates(x=code_block, z=code_block_2)
byCoordinates_2 = Point.ByCoordinates(x=code_block_3)

# group: Nejdelší vázání
# note: Nejdelší vázání
# Je nakresleno tolik čar, kolik je položek v delším seznamu vstupních bodů. Pokud uzlu dojdou body v kratším seznamu, vytvoří tolik kopií poslední položky, kolik bude potřebovat, aby dosáhl závěrečné položky v nejdelším seznamu.
byStartPointEndPoint = Line.ByStartPointEndPoint(startPoint=byCoordinates, endPoint=byCoordinates_2, lacing=Longest)

# group: Vytvořit body
# Vytvoří 2 sady bodů pro (10 x 6), které se použijí jako vstup pro uzel Line.ByStartPointEndPoint
byCoordinates_3 = Point.ByCoordinates(x=code_block_4, y=code_block_5.out0, z=code_block_5.out1)
byCoordinates_4 = Point.ByCoordinates(x=code_block_6, y=code_block_5.out0)

# group: Nejkratší vázání
# note: Nejkratší vázání
# Je nakresleno jen tolik čar, kolik je položek v nejkratším seznamu vstupů. Body „navíc“ v delším seznamu jsou ignorovány.
byStartPointEndPoint_2 = Line.ByStartPointEndPoint(startPoint=byCoordinates_3, endPoint=byCoordinates_4)

# group: Vytvořit body
# Vytvoří 2 sady bodů pro (10 x 6), které se použijí jako vstup pro uzel Line.ByStartPointEndPoint
byCoordinates_5 = Point.ByCoordinates(x=code_block_7, y=code_block_8.out0, z=code_block_8.out1)
byCoordinates_6 = Point.ByCoordinates(x=code_block_9, y=code_block_8.out0)

# group: Vázání kartézským součinem
# note: Vázání kartézským součinem
# Jsou provedeny všechny možné kombinace párování. Pro 10 bodů v delším seznamu a 6 v kratším seznamu bude výsledkem 10 x 6 = 60 čar.
byStartPointEndPoint_3 = Line.ByStartPointEndPoint(startPoint=byCoordinates_5, endPoint=byCoordinates_6, lacing=CrossProduct)
# note: Výsledné čáry budou uloženy ve vnořeném seznamu, buď 6 seznamů o 10 čárách, nebo 10 seznamů o 6 čárách, a to v závislosti na tom, který seznam je určen jako první.
watch = Watch(byStartPointEndPoint_3)
