# Dynamo graph Core_Math.dyn (Dynamo 3.4.1.7055)
# author: Dynamo Team
# Toto je podrobný výklad o různých matematických funkcí a možností aplikace Dynamo

# group: Info
# note: MATEMATIKA
# Matematiku je v aplikaci Dynamo možné řešit pomocí uzlů z knihovny Math a z knihovny Operators, případně pomocí uzlu Code Block. Níže jsou uvedeny způsoby provedení několika základních matematických operací s každou z těchto tří metod.

# group: Základní aritmetické operátory
# note: Aritmetické operátory, například
# +, -, *, /, %

# group: Základní logické operátory
# note: Operátory porovnání (například
# <, >, <=, >=, !=, == )

# group: Booleovské operátory
# note: Logické operátory
# (V knihovně najdete další.)

# group: Zaokrouhlení
# note: Zaokrouhlení

# group: Složité matematické funkce
# 4 příklady dosažení stejného výsledku pomocí uzlů, jazyka Python, Fo
# note: This example shows four different ways to approach dealing with Math functions.  Each of these examples starts with a grid of points, calculates z-coordinates for the points and then makes a surface.  Only the calculation method differs; these methods all solve the same.
# 1. Nodes. Math nodes are in the Math section of the Library which is further split into Functions, Logic and Operators.
# 2. Python.
# 3. Code Block Node.  Double-click anywhere in the canvas to create a code block node.  Syntax for each function matches the name of the node in Dynamo.
# ** Note: You can adjust the resolution of the geometry preview by navigating to the Render Precision settings: Dynamo -> Preferences -> Visual Settings -> Render Precision
# note: Další informace o tomto příkladu:
# http://dynamobim.org/math-transit/

# group: Oblouk
# note: Vytvoří oblouk pomocí 2 samostatných metod, jednou pomocí uzlů a podruhé pomocí bloků kódu. Výsledky jsou pro přehlednost vizualizovány.

# group: Tip
# Zvýraznění uzlů geometrie
# note: Tip: Výběr uzlu, který kreslí geometrii, změní barvu vytvářené geometrie na modrozelenou. Tento blok kódu nakreslí osy grafu, body podél křivky a samotnou křivku.  Vyberte blok kódu, pokud chcete na pozadí zobrazit, kterou křivku tento blok kódu kreslí.

# group: Kosinová křivka
# note: Tato sada příkladů ukazuje způsob vykreslení grafu funkce kosinus pomocí uzlů a bloku kódu.
# Každý příklad přijímá řadu čísel jako hodnoty X pro řadu bodů, počítá hodnoty Y z hodnot X a poté nakreslí čáru ve tvaru kosinové křivky. Velký blok kódu na konci každého grafu přesune vykreslenou geometrii do jiné části obrazovky, aby se křivky nepřekrývaly.

# group: Tip
# Přesnost rendrování
# note: Tip: Adjust how precisely the geometry in the background preview is rendered by navigating to Dynamo -> Preferences -> Visual Settings -> Render Precision.  A higher value will make curved surfaces look smoother, but it will take more processing power to draw.

# group: Uzly > Počáteční vstup pro seznam bodů
code_block = CodeBlock { -10..10..#20; }

# group: Uzly > Tvorba a manipulace počátečního seznamu bodů
# note: Vytvoří rastr bodů.
# Všimněte si, že chování vázání je
# „kartézský součin“.
byCoordinates = Point.ByCoordinates(x=code_block, y=code_block, lacing=CrossProduct)
flatten = List.Flatten(list=byCoordinates)
X = Point.X(point=flatten)
Y = Point.Y(point=flatten)

# group: Uzly > Amplituda
# note: Amplituda
number_slider = DoubleSlider(5.51, range=0..10 step 0.1)  # graph input

# group: Uzly > Čtverec
number = DoubleInput(2)  # graph input
pow = Math.Pow(number=X, power=number)

# group: Uzly > Čtverec
number_2 = DoubleInput(2)  # graph input
pow_2 = Math.Pow(number=Y, power=number_2)

# group: Uzly > Frekvence
# note: Frekvence
number_slider_2 = DoubleSlider(1.724, range=0..6 step 0.1)  # graph input

# group: Uzly > Čtverec
number_3 = DoubleInput(2)  # graph input
pow_3 = Math.Pow(number=number_slider_2, power=number_3)

# group: Uzly > Řada matematických výpočtů a manipulace k vytvoření geometrie 'rýhování' pomocí uzlů
add = pow + pow_2
add_2 = add + pow_3
sqrt = Math.Sqrt(number=add_2)
# note: Úhly v aplikaci Dynamo jsou ve stupních
radiansToDegrees = Math.RadiansToDegrees(radians=sqrt)
sin = Math.Sin(angle=radiansToDegrees)
div = sin / sqrt
mul = number_slider * div

# group: Uzly > Shromáždí výsledné body a připraví konečné rendrování
byCoordinates_2 = Point.ByCoordinates(x=X, y=Y, z=mul)
# note: Spočítá počet skupin bodů z počáteční kolekce bodů (20x20)
count = List.Count(list=byCoordinates)

# group: Uzly > Kolekce bodů
# note: Rozdělí plochý seznam do série
# seznamů podle řádku.
chop = List.Chop(list=byCoordinates_2, lengths=count)

# group: Uzly > Síť křivek
# note: Vytvoří křivky NURBS
# prostřednictvím bodů.
byPoints = NurbsCurve.ByPoints(points=chop)

# group: Uzly > Konečný povrch
# note: Vytvoří povrch.
byLoft = Surface.ByLoft(crossSections=byPoints)

# group: Blok kódu > Počáteční vstup pro seznam bodů
code_block_2 = CodeBlock { -10..10..#20; }

# group: Blok kódu > Tvorba a manipulace počátečního seznamu bodů
byCoordinates_3 = Point.ByCoordinates(x=code_block_2, y=code_block_2, lacing=CrossProduct)
flatten_2 = List.Flatten(list=byCoordinates_3)
Y_2 = Point.Y(point=flatten_2)
X_2 = Point.X(point=flatten_2)

# group: Blok kódu > Pomocná funkce k přesunu geometrie
# note: Uvolňuje místo pro geometrii.
code_block_3 = CodeBlock(x=Y_2) { x+60; }

# group: Blok kódu > Frekvence
number_slider_3 = DoubleSlider(1.724, range=0..5 step 0.1)  # graph input

# group: Blok kódu > Amplituda
number_slider_4 = DoubleSlider(5.51, range=0..10 step 0.1)  # graph input

# group: Blok kódu > Řada matematických výpočtů a manipulace k vytvoření geometrie 'rýhování' pomocí jazyka Python
# note: Názvy pro matematické metody odpovídají názvům uzlů aplikace Dynamo použitých v prvním příkladu.
code_block_4 = CodeBlock(x=X_2, y=Y_2, c=number_slider_3, A=number_slider_4)
# ---------- code_block_4.designscript (6 lines) ----------
sum = Math.Pow(x,2) + Math.Pow(y,2) + Math.Pow(c,2);

num1 = Math.Sqrt(sum);
num2 = Math.Sin( Math.RadiansToDegrees(num1) );

A * num2 / num1;
# ----------------------------------------

# group: Blok kódu > Shromáždí výsledné body a připraví konečné rendrování
byCoordinates_4 = Point.ByCoordinates(x=code_block_3, y=X_2, z=code_block_4.out3)
count_2 = List.Count(list=byCoordinates_3)

# group: Blok kódu > Kolekce bodů
chop_2 = List.Chop(list=byCoordinates_4, lengths=count_2)

# group: Blok kódu > Síť křivek
byPoints_2 = NurbsCurve.ByPoints(points=chop_2)

# group: Blok kódu > Konečný povrch
byLoft_2 = Surface.ByLoft(crossSections=byPoints_2)

# group: Jazyk Python > Počáteční vstup pro seznam bodů
code_block_5 = CodeBlock { -10..10..#20; }

# group: Jazyk Python > Tvorba a manipulace počátečního seznamu bodů
byCoordinates_5 = Point.ByCoordinates(x=code_block_5, y=code_block_5, lacing=CrossProduct)
flatten_3 = List.Flatten(list=byCoordinates_5)
X_3 = Point.X(point=flatten_3)
Y_3 = Point.Y(point=flatten_3)

# group: Jazyk Python > Pomocná funkce k přesunu geometrie
# note: Uvolňuje místo pro geometrii.
code_block_6 = CodeBlock(x=X_3) { x+30; }

# group: Jazyk Python > Amplituda
number_slider_5 = DoubleSlider(5.51, range=0..10 step 0.1)  # graph input

# group: Jazyk Python > Frekvence
number_slider_6 = DoubleSlider(1.724, range=0..5 step 0.1)  # graph input

# group: Jazyk Python > Řada matematických výpočtů a manipulace k vytvoření geometrie 'rýhování' pomocí jazyka Python
python_script = Python(Amplitude=number_slider_5, X=X_3, Y=Y_3, Frequency=number_slider_6)  # CPython3
# ---------- python_script.python (27 lines) ----------
import clr
clr.AddReference('ProtoGeometry')
from Autodesk.DesignScript.Geometry import *

import math

# The inputs to this node will be stored as a list in the IN variable.
amp = IN[0]   # single value
x = IN[1]     # list
y = IN[2]     # list (expect same length as x)
c = IN[3]     # single value

# Declare an empty array of z-values
z = []

# Solve the equation for each x and y value
for index in range(len(x)):
	sum = math.pow(x[index],2) + math.pow(y[index],2) + math.pow(c,2)
	num1 = math.sqrt(sum)
	num2 = math.sin(num1)
	zVal = amp * num2 / num1
	
	# Append the answer to the list of z values
	z.append(zVal)

# Assign the z-values to the OUT variable
OUT = z
# ----------------------------------------

# group: Jazyk Python > Shromáždí výsledné body a připraví konečné rendrování
byCoordinates_6 = Point.ByCoordinates(x=code_block_6, y=Y_3, z=python_script)
count_3 = List.Count(list=byCoordinates_5)

# group: Jazyk Python > Kolekce bodů
chop_3 = List.Chop(list=byCoordinates_6, lengths=count_3)

# group: Jazyk Python > Síť křivek
byPoints_3 = NurbsCurve.ByPoints(points=chop_3)

# group: Jazyk Python > Konečný povrch
byLoft_3 = Surface.ByLoft(crossSections=byPoints_3)

# group: Křivka kosinu pomocí bloků kódu > Vstupy
# note: Základní bod souřadnic
code_block_7 = CodeBlock { 25; 20; }
# note: Řada hodnot X
code_block_8 = CodeBlock { 0..10..#20; }
# note: Amplituda
number_slider_7 = DoubleSlider(3, range=0..10 step 0.1)  # graph input
# note: Frekvence
number_slider_8 = DoubleSlider(36, range=0..100 step 0.1)  # graph input

# group: Křivka kosinu pomocí bloků kódu > Funkce křivky Kosinus
# Získá hodnotu kosinu pro danou frekvenci a úhel a vynásobí ji amplitudou
code_block_9 = CodeBlock(amplitude=number_slider_7, frequency=number_slider_8, angle=code_block_8) { amplitude * Math.Cos(frequency * angle); }

# group: Křivka kosinu pomocí bloků kódu > Zprostředkující operace
byCoordinates_7 = Point.ByCoordinates(x=code_block_7.out0, y=code_block_7.out1)
byCoordinates_8 = Point.ByCoordinates(x=code_block_8, y=code_block_9)

# group: Křivka kosinu pomocí bloků kódu > Vytvoření a vizualizace kosinové křivky
code_block_10 = CodeBlock(base=byCoordinates_7, pts=byCoordinates_8)
# ---------- code_block_10.designscript (14 lines) ----------
// Make axes from base point
dimension = 10;
top = Point.ByCoordinates(base.X, base.Y + dimension/2);
bottom = Point.ByCoordinates(base.X, base.Y - dimension/2);
right = Point.ByCoordinates(base.X + 10, base.Y);
Line.ByStartPointEndPoint(bottom, top);
Line.ByStartPointEndPoint(base, right);

// Move function results to base point
vec = base.AsVector();
newPts = pts.Add(vec);

// Draw a line through the points
NurbsCurve.ByPoints(newPts);
# ----------------------------------------

# group: Kosinová křivka pomocí uzlů > Vstupy
# note: Souřadnice x,y základního bodu
code_block_11 = CodeBlock { -5; 20; }
# note: Řada hodnot X
code_block_12 = CodeBlock { 0..10..#20; }
# note: Frekvence
number_slider_9 = DoubleSlider(36, range=0..100 step 0.1)  # graph input

# group: Kosinová křivka pomocí uzlů > Řídí amplitudu
# note: Amplituda
number_slider_10 = DoubleSlider(3, range=0..10 step 0.1)  # graph input

# group: Kosinová křivka pomocí uzlů
mul_2 = number_slider_9 * code_block_12

# group: Kosinová křivka pomocí uzlů > Funkce Math.Cos
# Získá hodnotu kosinu pro každé počáteční číslo
cos = Math.Cos(angle=mul_2)

# group (continued): Kosinová křivka pomocí uzlů
mul_3 = number_slider_10 * cos

# group: Kosinová křivka pomocí uzlů > Zprostředkující operace
byCoordinates_9 = Point.ByCoordinates(x=code_block_11.out0, y=code_block_11.out1)
# note: Tip: Funkci náhledu můžete zapnout nebo vypnout pro libovolný uzel, který vytváří geometrii. Klikněte pravým tlačítkem a zaškrtněte políčko Náhled, případně jeho zaškrtnutí zrušte.
byCoordinates_10 = Point.ByCoordinates(x=code_block_12, y=mul_3)

# group: Kosinová křivka pomocí uzlů > Vytvoření a vizualizace kosinové křivky
code_block_13 = CodeBlock(base=byCoordinates_9, pts=byCoordinates_10)  # same code as code_block_10

# group: Oblouk pomocí uzlů > Vstupy
# Vytvořte nezbytné vstupy:
# 1. Střed
# 2. Poloměr
# 3. Počáteční úhel
# 4. Koncový úhel
# 5. Normála (osa Z)
code_block_14 = CodeBlock { 0; 35; }
byCoordinates_11 = Point.ByCoordinates(x=code_block_14.out0, y=code_block_14.out1)
code_block_15 = CodeBlock { 5; 0; }
# note: Přesunutím posuvníku změníte délku oblouku.
number_slider_11 = DoubleSlider(247.821, range=0..360 step 0.1)  # graph input
ZAxis = Vector.ZAxis()

# group: Oblouk pomocí uzlů > Vytvořit oblouk pomocí středu, poloměru a úhlu
# note: Úhly v uzlech nebo bloku kódu jsou v radiánech.
byCenterPointRadiusAngle = Arc.ByCenterPointRadiusAngle(center=byCoordinates_11, radius=code_block_15.out0, startAngle=code_block_15.out1, endAngle=number_slider_11, normal=ZAxis)

# group: Oblouk pomocí uzlů > Vizualizace výstupů
endPoint = Curve.EndPoint(curve=byCenterPointRadiusAngle)
byStartPointEndPoint = Line.ByStartPointEndPoint(startPoint=endPoint, endPoint=byCoordinates_11)
startPoint = Curve.StartPoint(curve=byCenterPointRadiusAngle)
byStartPointEndPoint_2 = Line.ByStartPointEndPoint(startPoint=startPoint, endPoint=byCoordinates_11)

# group: Operace používající uzly > -
code_block_16 = CodeBlock { 5; 2; }
sub = code_block_16.out0 - code_block_16.out1
watch = Watch(sub)

# group: Operace používající bloky kódu > -
code_block_17 = CodeBlock { 5-2; }
watch_2 = Watch(code_block_17)

# group: Operace používající bloky kódu > %
code_block_18 = CodeBlock { 5%2; }
watch_3 = Watch(code_block_18)

# group: Operace používající uzly > %
code_block_19 = CodeBlock { 5; 2; }
mod = code_block_19.out0 % code_block_19.out1
watch_4 = Watch(mod)

# group: Operace používající bloky kódu > <=
code_block_20 = CodeBlock { 5<=2; }
watch_5 = Watch(code_block_20)

# group: Operace používající bloky kódu > >
code_block_21 = CodeBlock { 5>2; }
watch_6 = Watch(code_block_21)

# group: Operace používající uzly > <=
code_block_22 = CodeBlock { 5; 2; }
le = code_block_22.out0 <= code_block_22.out1
watch_7 = Watch(le)

# group: Operace používající uzly > >
code_block_23 = CodeBlock { 5; 2; }
gt = code_block_23.out0 > code_block_23.out1
watch_8 = Watch(gt)

# group: Oblouk pomocí bloků kódu > Vstupy
# Vytvořte potřebné vstupy:
# 1. Střed
# 2. Koncový úhel
code_block_24 = CodeBlock { 15; 35; }
byCoordinates_12 = Point.ByCoordinates(x=code_block_24.out0, y=code_block_24.out1)
number_slider_12 = DoubleSlider(126.947, range=0..360 step 0.1)  # graph input

# group: Oblouk pomocí bloků kódu > Vytvořit oblouk pomocí středového bodu, poloměru a úhlu
code_block_25 = CodeBlock(center=byCoordinates_12, endAngle=number_slider_12) { Arc.ByCenterPointRadiusAngle(center,5,0,endAngle,Vector.ZAxis()); }

# group: Oblouk pomocí bloků kódu > Vizualizace výstupů
startPoint_2 = Curve.StartPoint(curve=code_block_25)
byStartPointEndPoint_3 = Line.ByStartPointEndPoint(startPoint=startPoint_2, endPoint=byCoordinates_12)
endPoint_2 = Curve.EndPoint(curve=code_block_25)
byStartPointEndPoint_4 = Line.ByStartPointEndPoint(startPoint=endPoint_2, endPoint=byCoordinates_12)

# group: Zaokrouhlení pomocí uzlů > Vstupy
code_block_26 = CodeBlock { 3.14159; }
code_block_27 = CodeBlock { 3; }

# group: Zaokrouhlení pomocí uzlů > Zaokrouhlit dolů
floor = Math.Floor(number=code_block_26)
watch_9 = Watch(floor)

# group: Zaokrouhlení pomocí uzlů > Zaokrouhlit nahoru
ceiling = Math.Ceiling(number=code_block_26)
watch_10 = Watch(ceiling)

# group: Zaokrouhlení pomocí uzlů > Zaokrouhlit nahoru nebo dolů
# To, co je blíže
round = Math.Round(number=code_block_26)
watch_11 = Watch(round)

# group: Zaokrouhlení pomocí uzlů > Zaokrouhlí na určený počet číslic
round_2 = Math.Round(number=code_block_26, digits=code_block_27)
watch_12 = Watch(round_2)

# group: Zaokrouhlení pomocí bloků kódu > Vstupy
code_block_28 = CodeBlock { 3.14159; }

# group: Zaokrouhlení pomocí bloků kódu > Zaokrouhlit dolů
code_block_29 = CodeBlock(num=code_block_28) { Math.Floor(num); }
watch_13 = Watch(code_block_29)

# group: Zaokrouhlení pomocí bloků kódu > Zaokrouhlit nahoru
code_block_30 = CodeBlock(num=code_block_28) { Math.Ceiling(num); }
watch_14 = Watch(code_block_30)

# group: Zaokrouhlení pomocí bloků kódu > Zaokrouhlit nahoru nebo dolů.
# To, co je blíže
code_block_31 = CodeBlock(num=code_block_28) { Math.Round(num); }
watch_15 = Watch(code_block_31)

# group: Zaokrouhlení pomocí bloků kódu > Zaokrouhlí na určený počet číslic
# Popis <Dvojitým kliknutím sem upravte popis skupiny>
code_block_32 = CodeBlock(num=code_block_28) { Math.Round(num,3); }
watch_16 = Watch(code_block_32)

# group: Operace používající bloky kódu > ==(rovná se)
code_block_33 = CodeBlock { true == false; }
watch_17 = Watch(code_block_33)

# group: Operace používající bloky kódu > Not
code_block_34 = CodeBlock { !true; }
watch_18 = Watch(code_block_34)

# group: Operace používající bloky kódu > && (logický and)
code_block_35 = CodeBlock { true && false; }
watch_19 = Watch(code_block_35)

# group: Operace používající bloky kódu > || (logický or)
code_block_36 = CodeBlock { true || false; }
watch_20 = Watch(code_block_36)

# group: Operace používající uzly > ==(rovná se)
boolean = BoolSelector(true)  # graph input
boolean_2 = BoolSelector(false)  # graph input
eq = boolean == boolean_2
watch_21 = Watch(eq)

# group: Operace používající uzly > || (logický or)
boolean_3 = BoolSelector(true)  # graph input
boolean_4 = BoolSelector(false)  # graph input
or_ = boolean_3 || boolean_4
watch_22 = Watch(or_)

# group: Operace používající uzly > && (logický and)
boolean_5 = BoolSelector(true)  # graph input
boolean_6 = BoolSelector(false)  # graph input
and_ = boolean_5 && boolean_6
watch_23 = Watch(and_)

# group: Operace používající uzly > Not
boolean_7 = BoolSelector(true)  # graph input
not_ = Not(x=boolean_7)
watch_24 = Watch(not_)
