# Dynamo graph Core_PassingFunctions.dyn (Dynamo 3.1.0.3411)
# author: Dynamo Team
# Demonstruje způsob předání funkce do aplikace Dynamo

# group: Info
# note: PŘEDÁVÁNÍ FUNKCÍ
# Aplikace Dynamo je funkční jazyk, což znamená, že s AKCEMI lze nakládat stejným způsobem jako s OBJEKTY. Většinu uzlů v aplikaci Dynamo je možné převést na funkce a použít velmi přesným způsobem u sady dat.
# Vytvoření funkce a předání funkce je podobné, jako bychom vyslovili příkaz „Spustit po dobu 20 minut!“, ale teprve později bychom upřesnili, na koho hovoříme.
# V tomto příkladu je rastr kružnice reprezentován ve složité struktuře. Příkaz pro výběr sady kružnic se použije přímo a poté je příkaz místo toho předán jako funkce dolním úrovním dat, čímž vznikne jiný výsledek.

# group: Počáteční vstupy
# Vytvoří matici bodů 5x8
code_block = CodeBlock { 0..#8..4; }
code_block_2 = CodeBlock { 0..#5..4; }
byCoordinates = Point.ByCoordinates(x=code_block, y=code_block_2, lacing=CrossProduct)

# group: Nakeslí matici kružnic
# note: Tento seznam bodů je uspořádán do hierarchické struktury -- jde o seznam seznamů.  Osnova byla vytvořena s 8 body ve směru osy X a 5 ve směru osy Y. Tento seznam představuje 8 seznamů o 5 položkách, nebo seznamy sloupců bodů.
watch = Watch(byCoordinates)
code_block_3 = CodeBlock { 1.5; }
# note: Nakreslete kružnici kolem každého bodu.
byCenterPointRadius = Circle.ByCenterPointRadius(centerPoint=watch, radius=code_block_3)

# group: Vybere druhý a třetí SEZNAM
# Předávání funkce
code_block_4 = CodeBlock { 1..2; }
# note: Z vnořeného seznamu kružnic jsou vybrány položky {1,2}. Uzly aplikace Dynamo budou vždy působit na seznam „zvnějšku dovnitř“, neboli z nejvyšší úrovně na nejnižší úroveň.
# Výběrem položek 1 a 2 ze seznamu se vrátí seznam č. 1 a seznam č. 2 z původní struktury vnořeného seznamu.
getItemAtIndex = List.GetItemAtIndex(list=byCenterPointRadius, index=code_block_4)

# group: Vysunutí NAHORU
# Výsledné válce
# note: Vybraná data stále existují ve stejné struktuře, v níž existovala před tím, než jsem ji vybral pomocí mapování.
watch_2 = Watch(getItemAtIndex)
code_block_5 = CodeBlock { 3; }
# note: Tento seznam kružnic se vysune směrem nahoru.
extrude = Curve.Extrude(curve=watch_2, distance=code_block_5)

# group: Vybere druhou a třetí POLOŽKU z KAŽDÉHO SEZNAMU
# Předávání funkce
code_block_6 = CodeBlock { 1..2; }
# note: Funkce List@Level umožňuje místo načtení prvních dvou seznamů z výstupu uzlu načíst 1. a 2. položku z KAŽDÉHO seznamu, a to tak, že na vstupním portu uzlu List.GetItemAtIndex vyberete možnost L2.
# Tato funkce řeší funkci metody List.Map, pomocí které bylo možné získat přístup k vnitřním úrovním seznamů vstupů v předchozích verzích aplikace Dynamo.
getItemAtIndex_2 = List.GetItemAtIndex(list=byCenterPointRadius@L2, index=code_block_6)

# group: Vysunutí DOLŮ
# Výsledné válce
watch_3 = Watch(getItemAtIndex_2)
code_block_7 = CodeBlock { -3; }
# note: Tento seznam kružnic se vysune směrem dolů.
extrude_2 = Curve.Extrude(curve=watch_3, distance=code_block_7)
