# Dynamo graph Core_Python.dyn (Dynamo 4.1.0.2940)
# author: Dynamo Team
# Použití uzlu Python uvnitř aplikace Dynamo

# group: Info
# note: PYTHON
# Aplikace Dynamo podporuje jazyk CPython prostřednictvím jednoho ze dvou typů uzlů jazyka Python. (Druhý typ uzlu jazyka Python, který zde není ukázán, umí číst skript z externího souboru, který má být spuštěn.)
# Dvojitým kliknutím na uzel Python zobrazíte skript, který obsahuje.
# Vstup je obsažen v poli IN. Výstup musí být přiřazen do proměnné OUT. Výstup může být jedna hodnota nebo samotné pole.

# group: Použití manipulace se znaménkem na seznam pomocí uzlu Python
# note: V tomto příkladu se budou odečítat nebo přičítat všechny položky v seznamu. Jeho vstupy jsou číslo, jehož znaménko určuje, zda se má použít součet nebo rozdíl, a seznam čísel.

# group: Vyberte kladné číslo, 0 nebo záporné číslo
# Popis <Dvojitým kliknutím sem upravte popis skupiny>
# note: Vyberte znaménko pro operaci
#     číslo < 0 odečíst všechny
#     číslo = 0 0
#     číslo > 0 přičíst všechny
integer_slider = IntegerSlider(1, range=-1..2 step 1)

# group: Vytvoří vstupní seznam
# note: Vytvořit libovolný seznam
code_block = CodeBlock { 0..10; }
watch = Watch(code_block)

# group: Python
# Použije manipulaci se znaménkem
# note: Výstup z pole OUT je pole, kde první položka je jedna hodnota a druhá položka je seznam hodnot. Tato datová struktura byla určena v samotné definici jazyka Python. Určení pole umožňuje přenést libovolný počet výstupů do grafu aplikace Dynamo.
python_script = Python(Sign=integer_slider, List=watch)  # PythonNet3
# ---------- python_script.python (31 lines) ----------
# Python script to find add or subtract a series of numbers. 

# Boiler-plate import statments included out-of-the-box
import clr
clr.AddReference('ProtoGeometry')
from Autodesk.DesignScript.Geometry import *

# The inputs to this node will be stored as a list in the IN variable.
sign = IN[0]  # -1 for subtract all, 0 for do nothing, 1 for add all
nums = IN[1]  # List of numbers to subtract or add

partials = [] # Empty array to contain partial sums or differences
result = 0    # Initialize the sum or difference to 0

# Loop through each item and add it or subtract it from the result.
for index in range(len(nums)):
	if sign > 0:
		result = result + nums[index]
		partials.append(result)
	elif sign == 0:
		partials.append(result)
		continue
	else:
		result = result - nums[index]
		partials.append(result)

# Assign the output to the OUT variable
#OUT = results  # Use this to output only the result.
OUT = []
OUT.append(result)
OUT.append(partials)
# ----------------------------------------

# group: Výsledný seznam
code_block_2 = CodeBlock { 1; }
getItemAtIndex = List.GetItemAtIndex(list=python_script, index=code_block_2)
# note: Řada částečných výsledků
watch_2 = Watch(getItemAtIndex)

# group: Výsledný součet
code_block_3 = CodeBlock { 0; }
getItemAtIndex_2 = List.GetItemAtIndex(list=python_script, index=code_block_3)
# note: Celkový výsledek
watch_3 = Watch(getItemAtIndex_2)

# group: Tvorba geometrie v jazyce Python
# note: Tento příklad v jazyce Python nemá žádné vstupy. To ukazuje, jak vytvořit geometrii pomocí knihovny protogeometrie aplikace Dynamo. Protože uzel Python vytvoří viditelnou geometrii, tak jeho vybrání, stejně jako u všech ostatních uzlů, způsobí zvýraznění geometrie.
python_script_2 = Python()  # PythonNet3
# ---------- python_script_2.python (24 lines) ----------
import clr
clr.AddReference('ProtoGeometry')
from Autodesk.DesignScript.Geometry import *
#The inputs to this node will be stored as a list in the IN variable.
dataEnteringNode = IN

p1 = Point.ByCoordinates(0, 0, 0);
p2 = Point.ByCoordinates(-10, -10, -10);

l = Line.ByStartPointEndPoint(p1, p2);

pts = [
	Point.ByCoordinates(0, 0, 0),
	Point.ByCoordinates(10, 10, 0),
	Point.ByCoordinates(20, 0, 0),
	Point.ByCoordinates(30, 10, 0),
	Point.ByCoordinates(40, 0, 0) ]
	
spline = NurbsCurve.ByPoints(pts)

surf = spline.Extrude(Vector.ByCoordinates(0, 0, 1), 10)

#Assign your output to the OUT variable
OUT = [l, spline, surf]
# ----------------------------------------

# group: Kontrola výsledného výstupu
# note: Tip: Pomocí uzlu Code Block lze
# přistupovat k určitým položkám v seznamu.
code_block_4 = CodeBlock(output=python_script_2) { output[0]; output[1]; output[2]; }
watch_4 = Watch(code_block_4.out2)
watch_5 = Watch(code_block_4.out0)
watch_6 = Watch(code_block_4.out1)
