# Dynamo graph Core_RangeSyntax.dyn (Dynamo 3.0.0.6964)
# author: Dynamo Team
# Tento graf nabízí několik způsobů generování řady rovnoměrně rozmístěných čísel nebo znaků.

# group: Info
# note: Syntaxe rozsahu
# Existuje několik způsobů, jak vytvořit seznamy jako posloupnosti čísel nebo znaků.
# Posloupnosti mohou být užitečné při tvorbě polí prvků, iterací a jako příprava pro různé funkce a rovnice.

# group: Použití bloku kódu
# note: start..end..step
# Od 0 do 10 s krokem 2
# Tato metoda je ekvivalentní k použití uzlu Range
code_block = CodeBlock { 0..10..2; }
watch = Watch(code_block)
# note: start..end
# Pokud hodnota step není určena, předpokládá se, že má hodnotu 1.
# Tato metoda je identická k použití uzlu Range
# note: Použijte syntaxi rozsahu v uzlu Code Block. Máte k dispozici několik metod generování řady čísel (nebo znaků):
#         start..end..step
#         start..end..#množství
#         start..#množství..interval
# start = číslo / znak zahajující řadu
# end = číslo/znak, kterým řada končí
# step = rozdíl mezi dvěma po sobě jdoucími čísly / znaky
# množství = kolik čísel / znaků je v řadě
code_block_2 = CodeBlock { 0..10; }
watch_2 = Watch(code_block_2)
# note: start..end..#množství
# Od 0 do 10 ve 3 položkách step
code_block_3 = CodeBlock { 0..10..#3; }
watch_3 = Watch(code_block_3)
# note: start..#množství..interval
# 10 položek step začínajících od 0, každý step roven 3
# Tento postup je ekvivalentní k použití uzlu Sequence
code_block_4 = CodeBlock { 0..#10..3; }
watch_4 = Watch(code_block_4)

# group: Použijte blok kódu s dynamickým vstupem
integer_slider = IntegerSlider(7, range=0..10 step 1)
# note: Nahraďte hodnotu proměnnou a pomocí posuvníku dynamicky řiďte délku seznamu.
code_block_5 = CodeBlock(howMany=integer_slider) { 0..#howMany..3; }
watch_5 = Watch(code_block_5)

# group: Použití uzlu Sequence
number = DoubleInput(0)
number_slider = DoubleSlider(8, range=0..10 step 0.1)
number_2 = DoubleInput(2)
# note: Uzel Sequence použijte, pokud je znám počet položek v seznamu a délka každé položky step. Poslední výsledek v seznamu není předdefinovaný, ale je vypočítán podle jiných vstupů.
# Příklad: návrh parkoviště s prostorem pro 8 aut a známou šířkou každého parkovacího místa. Celková šířka všech parkovacích míst závisí na jednotlivých šířkách a počtu parkovacích míst.
sequence = Sequence(start=number, amount=number_slider, step=number_2, lacing=Longest)
watch_6 = Watch(sequence)

# group: Použití uzlu Range
number_3 = DoubleInput(0)
number_4 = DoubleInput(10)
number_slider_2 = DoubleSlider(1.75, range=0..10 step 0.1)
# note: Použijte uzel Range, pokud je znám začátek a konec posloupnosti. Počet položek ve výsledném seznamu není předdefinován, ale je vypočítán, podle jiných vstupů.
# Je vhodné poznamenat, že poslední položka v seznamu nemusí odpovídat vstupu 'end', pokud by hodnota step překročila při další položce step hodnotu 'end'.
# Zvýšení hodnoty step mezi nastavenými hodnotami 'start' a 'end' může mít za následek méně položek a naopak, snížení položky step zvýší délku seznamu.
range = Range(start=number_3, end=number_4, step=number_slider_2, lacing=Longest)
watch_7 = Watch(range)

# group: Použití uzlu Range – s řetězci
string = StringInput("A")
string_2 = StringInput("P")
code_block_6 = CodeBlock { 1; }
# note: Uzel Range je možné použít také k vygenerování posloupností znaků.
range_2 = Range(start=string, end=string_2, step=code_block_6, lacing=Longest)
watch_8 = Watch(range_2)

# group: Použití uzlu Sequence – s řetězci
string_3 = StringInput("A")
code_block_7 = CodeBlock { 20; }
# note: Pomocí uzlu Sequence je možné vygenerovat řadu písmen v abecedním pořadí
sequence_2 = Sequence(start=string_3, amount=code_block_7)
watch_9 = Watch(sequence_2)

# note: Pomocí posloupnosti hodnot vytvořte řadu bodů
byCoordinates = Point.ByCoordinates(x=code_block_5)
