# Dynamo graph Core_Strings.dyn (Dynamo 3.4.1.7055)
# author: Dynamo Team
# Tento graf demonstruje akce, které je možné provést se řetězci.

# group: Info
# note: ŘETĚZCE
# Tato sada příkladů ukazuje některé akce, které je možné provést pomocí řetězců. Další uzly pro operace řetězců se nachází v knihovně uzlů v kategorii 'String'.

byCoordinates = Point.ByCoordinates()
code_block = CodeBlock { 5; }
# note: Tvorba objektu - kružnice
byCenterPointRadius = Circle.ByCenterPointRadius(centerPoint=byCoordinates, radius=code_block)

# group: Převést objekt na řetězec
# note: Převeďte objekt na popis řetězce sebe samotného.
string_from_object = FromObject(obj=byCenterPointRadius)

watch = Watch(string_from_object)

# group: Rozdělit řetězec pomocí oddělovačů
code_block_2 = CodeBlock { "("; ")"; " "; "="; ","; }
# note: Rozdělte řetězec na části určením jednoho nebo více oddělovacích znaků. Každý oddělovač může mít jeden nebo více znaků.
split = String.Split(string=watch, separator0=code_block_2.out0, separator1=code_block_2.out1, separator2=code_block_2.out2, separator3=code_block_2.out3, separator4=code_block_2.out4)

watch_2 = Watch(split)

# group: Zkontrolovat, zda řetězec obsahuje podřetězec
code_block_3 = CodeBlock { "."; }
# note: Zjistěte, zda řetězec obsahuje jiný řetězec.
contains = String.Contains(string=watch_2, searchFor=code_block_3)

watch_3 = Watch(contains)

# group: Vytvořit řetězec
# note: Pomocí uzlu Code Block vytvořte řetězec – značky "" označují hodnotu řetězce.
code_block_4 = CodeBlock { "Few things are harder to put up with than a good example."; }

# group: Změnit na VELKÁ PÍSMENA
string = StringInput(" - Mark Twain")
# note: Změnit velikost písma řetězce
toUpper = String.ToUpper(string=string)
watch_4 = Watch(toUpper)

# group: Zřetězit
# note: Propojení dvou řetězců dohromady za účelem vytvoření jednoho řetězce se nazývá „řetězení“ nebo zkráceně „řetěz“.
concat = String.Concat(string0=code_block_4, string1=watch_4)

watch_5 = Watch(concat)

# group: Nahradit znaky v řetězci
code_block_5 = CodeBlock { "put"; }
code_block_6 = CodeBlock { "come"; }
# note: Nahraďte všechny výskyty podřetězce nahrazujícím řetězcem.
replace = String.Replace(string=watch_5, searchFor=code_block_5, replaceWith=code_block_6)

watch_6 = Watch(replace)

# group: Vyhledat podřetězec v řetězci
code_block_7 = CodeBlock { " to"; }
# note: Najděte, kde se v řetězci vyskytuje určitý podřetězec. Výsledkem je index, na kterém začíná podřetězec.
indexOf = String.IndexOf(string=watch_6, searchFor=code_block_7)
watch_7 = Watch(indexOf)

# group: Délka řetězce
# note: Najděte celkový počet znaků v řetězci.
length = String.Length(string=watch_6)
watch_8 = Watch(length)

# note: Odečte první část řetězce od celkové délky řetězce.
sub = watch_8 - watch_7

# group: Odebrat znaky
# note: Odstraňte určitý počet znaků z řetězce.
remove = String.Remove(string=watch_6, startIndex=watch_7, count=sub)

# group: Spočítat výskyty
watch_9 = Watch(remove)
code_block_8 = CodeBlock { "ar"; }
# note: Spočítejte výskyty podřetězce uvnitř řetězce.
countOccurrences = String.CountOccurrences(string=watch_9, searchFor=code_block_8)
watch_10 = Watch(countOccurrences)

# group: Vytvořit řetězec
# note: If the string includes a " character, use an escape character \ before " to treat it as a part of the string and not the end of the string.
code_block_9 = CodeBlock { "There is no \"I\" in Team"; }
watch_11 = Watch(code_block_9)

rozsah_čísel = CodeBlock { 2..101; }

# group: Zřetězit řetězce pomocí operace 'Součet'
code_block_10 = CodeBlock { " Dalmatians"; }
# note: Operace 'Součet' automaticky převede čísla na řetězce a provede zřetězení
add = rozsah_čísel + code_block_10
watch_12 = Watch(add)

# group: Převést objekt na řetězec
# note: V některých případech je nutné nejprve převést objekt na řetězec
string_from_object_2 = FromObject(object=rozsah_čísel)
watch_13 = Watch(string_from_object_2)
type = Object.Type(object=string_from_object_2)
watch_14 = Watch(type)

# group: Převést řetězec na číslo
code_block_11 = CodeBlock { "101 Dalmatians"; }
code_block_12 = CodeBlock { " "; }
# note: Rozdělit řetězec na slova pomocí mezery jako oddělovače
split_2 = String.Split(string=code_block_11, separator0=code_block_12)
# note: Získat první položku v seznamu
firstItem = List.FirstItem(list=split_2)
# note: Převést řetězec na číslo
toNumber = String.ToNumber(string=firstItem)
watch_15 = Watch(toNumber)
type_2 = Object.Type(object=toNumber)
watch_16 = Watch(type_2)

# group: Převést řetězce na čísla
# note: Použijte seznam booleovských hodnot jako masku pro filtr, abyste získali všechna čísla v seznamu
filterByBoolMask = List.FilterByBoolMask(list=watch_2, mask=contains)
# note: Převést řetězce na čísla
toNumber_2 = String.ToNumber(string=filterByBoolMask.in)

watch_17 = Watch(filterByBoolMask.in)
