# Dynamo graph Geometry_Curves.dyn (Dynamo 3.1.0.3411)
# author: Dynamo Team
# Vzorový graf znázorňující způsob, jak vytvořit základní primitivy křivek – úsečku, objekt PolyCurve, otevřenou a uzavřenou křivku Nurbs

# group: Info
# note: Tento graf znázorňuje způsob, jak vytvořit základní primitivy křivek – úsečku, objekt PolyCurve, otevřenou a uzavřenou křivku Nurbs

# group: Počáteční vstupy
number = DoubleInput(5)
number_2 = DoubleInput(10)
number_3 = DoubleInput(15)

# group: Počáteční 4 body
byCoordinates = Point.ByCoordinates()
byCoordinates_2 = Point.ByCoordinates(y=number)
byCoordinates_3 = Point.ByCoordinates(x=number_2, y=number_2)
byCoordinates_4 = Point.ByCoordinates(x=number_3)

# group: Seznam 4 bodů
create = List.Create(item0=byCoordinates, item1=byCoordinates_2, item2=byCoordinates_3, item3=byCoordinates_4)

# group: Křivka Nurbs
# note: Vytvoří křivku Nurbs pomocí 4 bodů
byPoints = NurbsCurve.ByPoints(points=create)

# group: Úsečka
# note: Jedna přímá čára pomocí 2 bodů
byStartPointEndPoint = Line.ByStartPointEndPoint(startPoint=byCoordinates, endPoint=byCoordinates_2)

length = Curve.Length(curve=byStartPointEndPoint)

# group: Křivka Nurbs – uzavřená
boolean = BoolSelector(true)
# note: Vytvoří uzavřenou křivku Nurbs uvnitř ohraničujících bodů
byControlPoints = NurbsCurve.ByControlPoints(points=create, closeCurve=boolean)

# group: Objekt PolyCurve
# Popis <Dvojitým kliknutím sem upravte popis skupiny>
# note: Vytvoří přímý objekt PolyCurve procházející sadou bodů
# note: Nová poznámka
byPoints_2 = PolyCurve.ByPoints(points=create)

# group: Akce a dotazy
code_block = CodeBlock { 0..1..#20; }
# note: Křivky, objekty PolyCurve (kolekce křivek), objekty NURBS i čáry se odvozují od „křivek“, proto lze všechny „akce“ a „dotazy“ související s křivkami provádět u každé z těchto položek.
pointAtParameter = Curve.PointAtParameter(curve=byPoints_2, param=code_block)
