# Dynamo graph Geometry_Points.dyn (Dynamo 3.1.0.3411)
# author: Dynamo Team
# Vytvořit pole bodů

# group: Počáteční vstupy
number_slider = DoubleSlider(6.4, range=0..10 step 0.1)

# group: Jeden bod
# note: Základní geometrické prvky mají výchozí hodnoty u číselných vstupů. Zkontrolujte výchozí hodnoty přesunutím kurzoru nad vstupní port uzlu.
byCoordinates = Point.ByCoordinates(z=number_slider)

# group: Náhled výsledků
# note: Po stisknutí tlačítka "Spustit" nebo při zapnuté funkci Spustit automaticky se geometrická entita zobrazí buď v náhledu pozadí, v uzlu Watch 3D, nebo jako data v uzlu Watch. Prvky se zvýrazní na pozadí, jakmile je uzel vybrán.
watch_3d = Watch3D(byCoordinates)

# group: Počáteční vstupy
number = DoubleInput(0)
number_2 = DoubleInput(10)
number_3 = DoubleInput(1)

# group: Rozsah čísel
# note: Pole geometrií může být vytvořeno pomocí posloupností, rozsahů a seznamů.
range = Range(start=number, end=number_2, step=number_3, lacing=Longest)

# group: Matice bodů
# note: Vytvořte 1, 2 a 3rozměrná pole předáním rozsahů do portů x, y a z u bodů a poté změňte vlastnosti vázání v místní nabídce uzlu. Prohlédněte si výsledek při výběru možnosti vázání Kartézský součin.
byCoordinates_2 = Point.ByCoordinates(x=range, y=range, lacing=CrossProduct)

watch = Watch(byCoordinates)

# group: Změnit bod na vektor
# Popis <Dvojitým kliknutím sem upravte popis skupiny>
# note: Některé prvky je možné snadno převést na jiné
asVector = Point.AsVector(point=watch)

# group: Přesunout matici podle bodu jako vektor
# note: Odvozené prvky lze vytvořit pomocí nástrojů v podkategorii Akce entity.
add = Point.Add(point=byCoordinates_2, vectorToAdd=asVector)

# group: Souřadnice 'Z' bodu náhledu
# note: Informace je možné extrahovat z geometrie pomocí uzlů v podkategorii Dotaz u každého seskupení uzlů (vedle symbolu otazníku).
Z = Point.Z(point=byCoordinates)
