# Dynamo graph Geometry_Solids.dyn (Dynamo 3.1.0.3411)
# author: Dynamo Team
# Vzorový graf aplikace Dynamo znázorňující tvorbu tělesa pomocí možnosti Šablonování a manipulace s tělesem (přičítání a odčítání)

# group: Počáteční body pro první skupinu křivek
byCoordinates = Point.ByCoordinates()
number = DoubleInput(10)
byCoordinates_2 = Point.ByCoordinates(x=number)
byCoordinates_3 = Point.ByCoordinates(y=number)

# group: Další bod pro druhou skupinu křivek
number_2 = DoubleInput(5)
byCoordinates_4 = Point.ByCoordinates(z=number_2)

# group: Vytvořit počáteční křivky pro dolní základnu
byStartPointEndPoint = Line.ByStartPointEndPoint(startPoint=byCoordinates, endPoint=byCoordinates_2)
byThreePoints = Arc.ByThreePoints(firstPoint=byCoordinates, secondPoint=byCoordinates_4, thirdPoint=byCoordinates_2)

# group: Vytvořit dolní základnu
create = List.Create(item0=byStartPointEndPoint, item1=byThreePoints)
byJoinedCurves = PolyCurve.ByJoinedCurves(curves=create)

# group: Další bod pro třetí skupinu křivek
number_3 = DoubleInput(15)
byCoordinates_5 = Point.ByCoordinates(x=number_3, y=number_3)

# group: Další bod pro čtvrtou skupinu křivek
number_4 = DoubleInput(5)
number_5 = DoubleInput(10)
byCoordinates_6 = Point.ByCoordinates(x=number_4, y=number_5, z=number_5)

# group: Vytvořit počáteční křivky pro horní základnu
byStartPointEndPoint_2 = Line.ByStartPointEndPoint(startPoint=byCoordinates_3, endPoint=byCoordinates_5)
byThreePoints_2 = Arc.ByThreePoints(firstPoint=byCoordinates_3, secondPoint=byCoordinates_6, thirdPoint=byCoordinates_5)

# group: Vytvořit horní základnu
create_2 = List.Create(item0=byStartPointEndPoint_2, item1=byThreePoints_2)
byJoinedCurves_2 = PolyCurve.ByJoinedCurves(curves=create_2)

# group: Zkombinovat základní křivky do seznamu
create_3 = List.Create(item0=byJoinedCurves, item1=byJoinedCurves_2)

# group: Šablonování
# note: Většinu těles lze vytvořit několika způsoby. Tyto příklady ukazují uzavřené profily jako základní způsob, ale lze spojit i objekty PolySurface. K dispozici je mnoho primitiv (povrchy, kvádr, kužel atd.).
byLoft = Solid.ByLoft(crossSections=create_3)

# group: Objem
# note: Můžete zkontrolovat objem šablonování, což znázorní, že se jedná o uzavřenou geometrii tělesa
volume = Solid.Volume(solid=byLoft)

# group: Další bod pro další geometrii šablonování
number_6 = DoubleInput(-2)
number_7 = DoubleInput(5)
byCoordinates_7 = Point.ByCoordinates(x=number_6, y=number_7)

# group: Zkombinovat body do seznamu
create_4 = List.Create(item0=byCoordinates, item1=byCoordinates_7, item2=byCoordinates_3)

# group: Vytvořit další základní křivku
# Popis <Dvojitým kliknutím sem upravte popis skupiny>
# note: Tentokrát vytvořte křivku nurbs ze skupiny bodů
byPoints = NurbsCurve.ByPoints(points=create_4)

# group: Šablonování +
# note: Tip: Vypněte „Náhled“ v nabídce pravého tlačítka uzlu, pokud chcete vyloučit prvky ze zobrazení.
byLoft_2 = Solid.ByLoft(crossSections=create_3, guideCurves=byPoints)

# group: Geometrie +
code_block = CodeBlock { Vector.ByCoordinates(-20,0,0); }
# note: Přesunutím geometrie vizualizujte výstup
translate = Geometry.Translate(geometry=byLoft_2, direction=code_block)

# group: Připravit 'komponenty' k oříznutí geometrie tělesa
# note: Tloušťka
code_block_2 = CodeBlock { 0; }
# note: Tip: Vypněte „Náhled“ v nabídce pravého tlačítka uzlu, pokud chcete vyloučit prvky ze zobrazení.
thinShell = Solid.ThinShell(solid=byLoft, internalFaceThickness=code_block_2)
code_block_3 = CodeBlock { Vector.ByCoordinates(20,0,0); }
# note: Posunout geometrii ve směru X o 20 jednotek
translate_2 = Geometry.Translate(geometry=thinShell, direction=code_block_3)
code_block_4 = CodeBlock { Point.ByCoordinates(0,0,5); }
ZAxis = Vector.ZAxis()
# note: Vytvořit rovinu procházející tělesem k oříznutí
byOriginNormal = Plane.ByOriginNormal(origin=code_block_4, normal=ZAxis)
# note: Tento bod určuje, která část tělesa má být oříznuta
code_block_5 = CodeBlock { Point.ByCoordinates(10,10,10); }

# group: Šablonování -
# note: Geometrické logické operace (sjednocení, rozdíl, průnik atd.) jsou k dispozici v kategorii geometrie.
trim = Geometry.Trim(geometry=translate_2, other=byOriginNormal, pick=code_block_5)
