# Dynamo graph Geometry_Surfaces.dyn (Dynamo 3.1.0.3411)
# Graf aplikace Dynamo ukazující primární způsoby tvorby povrchů – vysunutí, šablonování a tažení.

# group: Info
# note: Graf aplikace Dynamo ukazující primární způsoby tvorby povrchů – vysunutí, šablonování a tažení

# group: Vstup
number = DoubleInput(10)
number_2 = DoubleInput(-10)
byCoordinates = Point.ByCoordinates(x=number, y=number_2)
byCoordinates_2 = Point.ByCoordinates(y=number_2)

# group: Úsečka
byStartPointEndPoint = Line.ByStartPointEndPoint(startPoint=byCoordinates, endPoint=byCoordinates_2)

# group: Vstup
byCoordinates_3 = Point.ByCoordinates()

# group: Vstup
number_3 = DoubleInput(5)
byCoordinates_4 = Point.ByCoordinates(z=number_3)

# group: Vstup
number_4 = DoubleInput(10)
byCoordinates_5 = Point.ByCoordinates(x=number_4)
byCoordinates_6 = Point.ByCoordinates(y=number_4)

# group: Oblouk
byThreePoints = Arc.ByThreePoints(firstPoint=byCoordinates_3, secondPoint=byCoordinates_4, thirdPoint=byCoordinates_5)

# group: Šablonování
create = List.Create(item0=byStartPointEndPoint, item1=byThreePoints)
# note: Pomocí 2 sad křivek můžeme mezi nimi vytvořit geometrii 'Šablonování'.
byLoft = Surface.ByLoft(crossSections=create)

# group: Vyhodnotit oblast šablonování
area = Surface.Area(surface=byLoft)
watch = Watch(area)

# group: Vstup
number_5 = DoubleInput(5)
number_6 = DoubleInput(10)
byCoordinates_7 = Point.ByCoordinates(x=number_5, y=number_6, z=number_6)

# group: Vstup
number_7 = DoubleInput(15)
byCoordinates_8 = Point.ByCoordinates(x=number_7, y=number_7)

# group: Oblouk
byThreePoints_2 = Arc.ByThreePoints(firstPoint=byCoordinates_6, secondPoint=byCoordinates_7, thirdPoint=byCoordinates_8)

# group: Vstup
number_8 = DoubleInput(-5)
number_9 = DoubleInput(5)
byCoordinates_9 = Point.ByCoordinates(x=number_8, y=number_9)

# group: Oblouk
byThreePoints_3 = Arc.ByThreePoints(firstPoint=byCoordinates_3, secondPoint=byCoordinates_9, thirdPoint=byCoordinates_6)

# group: Tažení
# note: Pro většinu povrchů existuje několik způsobů vytvoření. Povrchy, objekty PolySurface (kolekce povrchů) a povrchy NURBS lze vytvořit pomocí bodů, křivek a odvození z jiných povrchů a těles.
bySweep2Rails = Surface.BySweep2Rails(path=byThreePoints_2, guideRail=byThreePoints, profile=byThreePoints_3)

# group: Kombinovat šablonování a tažení
create_2 = List.Create(item0=byLoft, item1=bySweep2Rails)
# note: Povrchy spojené jako objekty PolySurface lze vyhodnotit jako jednu entitu.
byJoinedSurfaces = PolySurface.ByJoinedSurfaces(surfaces=create_2)

# group: Vyhodnotit kombinovanout oblast šablonování a tažení
area_2 = Surface.Area(surface=byJoinedSurfaces)
watch_2 = Watch(area_2)

# group: Vyhodnotit oblast tažení
area_3 = Surface.Area(surface=bySweep2Rails)
watch_3 = Watch(area_3)

# group: Extrahovat a použít body z povrchu
code_block = CodeBlock { 0..1..0.1; }
# note: Hrany, body a další prvky je možné odvodit od povrchů pomocí „akcí“ odpovídajících těmto geometriím
pointAtParameter = Surface.PointAtParameter(surface=bySweep2Rails, u=code_block, v=code_block, lacing=CrossProduct)
# note: Vytvořte nový povrch Nurbs pomocí extrahovaných parametrů (bodů).
# Skryjte ostatní geometrie, abyste mohli sledovat výsledek geometrie uvedené níže.
byControlPoints = NurbsSurface.ByControlPoints(controlVertices=pointAtParameter)
watch_3d = Watch3D(byControlPoints)

# group: Vysunout
code_block_2 = CodeBlock { 10; }
# note: Základní vysunutí ze zadané křivky
extrude = Curve.Extrude(curve=byThreePoints_2, distance=code_block_2)
