# Dynamo graph ImportExport_CSV to Stuff.dyn (Dynamo 3.1.0.3411)
# author: Dynamo Team
# Vytvořit geometrii podle analyzovaných dat souboru csv

# group: Počáteční vstup souboru helix.csv
# note: Vyhledejte soubor CSV, který obsahuje čísla
# v souřadnicovém prostoru X, Y a Z.
file_path = Filename("..\..\Data\helix.csv")

# group: Načíst soubor
fromPath = FileObject(path=file_path)  # "File.FromPath"
readText = FileSystem.ReadText(file=fromPath)

# group: Analyzovat data souboru csv
string = StringInput("\n")
# note: Rozdělit řetězec při
# návratu jezdce <enter>
split = String.Split(string=readText, separator0=string)
string_2 = StringInput(",")
# note: Rozdělit řetězce při čárce
split_2 = String.Split(string=split, separator0=string_2)
# note: Soubory CSV poskytují řetězce, nikoli čísla.
toNumber = String.ToNumber(string=split_2)
# note: Komponenty skupiny X, Y a Z
transpose = List.Transpose(lists=toNumber)

# group: Vytvoří geometrii 'spirála' podle načtených bodů ze souboru csv
# note: Souřadnice 'X'
firstItem = List.FirstItem(list=transpose)
code_block = CodeBlock { 1; }
# note: Souřadnice 'Y'
getItemAtIndex = List.GetItemAtIndex(list=transpose, index=code_block)
# note: Souřadnice 'Z'
lastItem = List.LastItem(list=transpose)
byCoordinates = Point.ByCoordinates(x=firstItem, y=getItemAtIndex, z=lastItem)

# group: Zvětšit měřítko
number_slider = DoubleSlider(2.337, range=0..20 step 0.1)
# note: Upravit celkovou distribuci
# souřadnicových bodů
scale = Geometry.Scale(geometry=byCoordinates, amount=number_slider, lacing=Longest)
