# Dynamo graph ImportExport_Data To Excel.dyn "mportExport_Data To Excel" (Dynamo 3.1.0.3411)
# author: Dynamo Team
# Znázorňuje způsob exportu dat z aplikace Dynamo do souboru .csv.

# group: Název <Dvojitým kliknutím sem upravte název skupiny>
number_slider = DoubleSlider(1.793, range=0..5 step 0.1)

# group: Název <Dvojitým kliknutím sem upravte název skupiny>
# Popis <Dvojitým kliknutím sem upravte popis skupiny>
# note: Nová poznámka
code_block = CodeBlock(numCircles=number_slider) { 0..(360*numCircles)..10; }
cos = Math.Cos(angle=code_block, lacing=Longest)
sin = Math.Sin(angle=code_block, lacing=Longest)
code_block_2 = CodeBlock(x=code_block) { x/100; }
byCoordinates = Point.ByCoordinates(x=cos, y=sin, z=code_block_2, lacing=Longest)
code_block_3 = CodeBlock(pt=byCoordinates) { [pt.X,pt.Y,pt.Z]; }

# group: Název <Dvojitým kliknutím sem upravte název skupiny>
# Popis <Dvojitým kliknutím sem upravte popis skupiny>
# note: Nová poznámka
file_path = Filename("..\..\Data\icosohedron_points.csv")
string = StringInput("helix")
number = DoubleInput(0)
transpose = List.Transpose(lists=code_block_3)
exportToExcel = Data.ExportToExcel(filePath=file_path, sheetName=string, startRow=number, startColumn=number, data=transpose)
