# Dynamo graph ImportExport_Excel to Dynamo.dyn (Dynamo 3.1.0.3411)
# author: Dynamo Team
# Vzorový graf znázorňuje způsob importu dat z aplikace Excel do aplikace Dynamo.

# group: Počáteční vstupy
# note: Přejděte na cestu k souboru .xlsx aplikace Excel, ze které se načtou data.
file_path = Filename("..\..\Data\helix.xlsx")
# note: Získá soubor z cesty k souboru.
fromPath = FileObject(path=file_path)  # "File.FromPath"
# note: Název listu v aplikaci Excel, který obsahuje data, která chceme importovat.
string = StringInput("helix")

# group: Import dat aplikace Excel
# note: Tento uzel může číst data pocházející z listu aplikace Excel. Načtou se data ze všech sloupců a řádků, jejichž výsledná data budou obsažena ve dvojitém poli [][] (matice).
importExcel = Data.ImportExcel(file=fromPath, sheetName=string)

# group: Transponovat
# note: Převrátit (transponovat) seznam (matici). Sloupce se stanou řádky a řádky se stanou sloupci.
transpose = List.Transpose(lists=importExcel)

# group: Extrahovat souřadnice bodů
number = DoubleInput(0)
# note: Souřadnice X
getItemAtIndex = List.GetItemAtIndex(list=transpose, index=number)
number_2 = DoubleInput(1)
# note: Souřadnice Y
getItemAtIndex_2 = List.GetItemAtIndex(list=transpose, index=number_2)
number_3 = DoubleInput(2)
# note: Souřadnice Z
getItemAtIndex_3 = List.GetItemAtIndex(list=transpose, index=number_3)

# group: Vytvoří šroubovici podle extrahovaných dat z aplikace Excel
byCoordinates = Point.ByCoordinates(x=getItemAtIndex, y=getItemAtIndex_2, z=getItemAtIndex_3, lacing=Longest)
