# Dynamo graph OpenXMLExport_Data To Excel.dyn "Data OpenXMLExport do aplikace Excel" (Dynamo 3.0.3.7594)
# author: Dynamo Team
# Vzorový graf znázorňující způsob exportu dat do aplikace Excel.

# group: Počáteční vstupy
# note: Řídí počet bodů. Považujte tuto hodnotu za 'výšku' šroubovice.
number_slider = DoubleSlider(1.7, range=0..5 step 0.1)

# group: Tvorba šroubovice
# note: Vytvořte řadu čísel od 0. Přírůstek je 10. Počet bodů je vynásoben 360, takže pokud je vstup 'numCircles' 1, výsledkem je 37 čísel (0 až 360) a vznikne plná rotace šroubovice.
code_block = CodeBlock(numCircles=number_slider) { 0..(360*numCircles)..10; }
# note: funkce kosinus
cos = Math.Cos(angle=code_block, lacing=Longest)
# note: funkce sinus
sin = Math.Sin(angle=code_block, lacing=Longest)
# note: dělení 100
code_block_2 = CodeBlock(x=code_block) { x/100; }
# note: Vytvořte seznam bodů, komponenta X je kosinus, komponenta Y je sinus a Z je počáteční hodnota vydělená 100.
byCoordinates = Point.ByCoordinates(x=cos, y=sin, z=code_block_2, lacing=Longest)
# note: Vytvořte strukturu seznamu ze seznamu bodů – výsledkem je seznam obsahující 3 seznamy ([][]] – dvojité pole), z nichž každý obsahuje souřadnice bodu X, respektive Y, respektive Z.
code_block_3 = CodeBlock(pt=byCoordinates) { [pt.X,pt.Y,pt.Z]; }

# group: Vytvořit vstupy pro export
# 1. Cesta k souboru CSV.
# 2. Název listu.
# 3. Transponovaný seznam bodů.
# 4. Počáteční index řádku a sloupce v aplikaci Excel.
# note: Cesta k souboru xlsx.
file_path = Filename("..\..\Data\icosohedron_points.xlsx")
# note: Název listu v aplikaci Excel.
string = StringInput("helix")
# note: Převrátit matici (transponovat seznam). Sloupce se stanou řádky a řádky se stanou sloupci.
transpose = List.Transpose(lists=code_block_3)
# note: Číslo sloupce / řádku, na kterém se mají data začít zaznamenávat do aplikace Excel
number = DoubleInput(0)

# group: Export dat do souboru aplikace Excel
# note: Exportuje data do aplikace Excel
openXMLExportExcel = Data.OpenXMLExportExcel(filePath=file_path, sheetName=string, data=transpose, startRow=number, startColumn=number)
