# Dynamo graph OpenXMLImport_Data From Excel.dyn "OpenXMLImport_Data z aplikace Excel" (Dynamo 3.1.0.3411)
# author: Dynamo Team
# Vzorový graf znázorňuje způsob importu dat ze souboru aplikace Excel.

# group: Počáteční vstupy
# 1. Cesta k souboru aplikace Excel.
# 2. Název listu
file_path = Filename("..\..\Data\helix.xlsx")
string = StringInput("helix")

# group: Extrahuje data z aplikace Excel
# note: Čtení dat z aplikace Excel
openXMLImportExcel = Data.OpenXMLImportExcel(filePath=file_path, sheetName=string)

# group: Analýza dat z aplikace Excel
# 'Analýza' dat je proces manipulace se zdrojem dat tak, aby data byla před jejich použitím nativní k používanému prostředí.
# note: Transponovat seznam (převrátit matici). Sloupce se stanou řádky a řádky se stanou sloupci.
transpose = List.Transpose(lists=openXMLImportExcel)
# note: první seznam
number = DoubleInput(0)
# note: druhý seznam
number_2 = DoubleInput(1)
# note: třetí seznam
number_3 = DoubleInput(2)

# group: Tvorba šroubovice
# note: Souřadnice X
getItemAtIndex = List.GetItemAtIndex(list=transpose, index=number)
# note: Souřadnice Y
getItemAtIndex_2 = List.GetItemAtIndex(list=transpose, index=number_2)
# note: Souřadnice Z
getItemAtIndex_3 = List.GetItemAtIndex(list=transpose, index=number_3)
byCoordinates = Point.ByCoordinates(x=getItemAtIndex, y=getItemAtIndex_2, z=getItemAtIndex_3, lacing=Longest)
