# Dynamo graph Basics_Basic01.dyn (Dynamo 2.19.3.6543)
# author: Dynamo Team
# Blöcke verbinden, um zwei Zahlen hinzuzufügen

# note: Grundlegende funktionale Eingaben wie Zahlen und Textzeichenfolgen können durch Navigieren oder durch Suchen in der Bibliothek auf der linken Seite des Ansichtsbereichs ausgewählt werden.
# Operationen, die für Daten ausgeführt werden können, z. B. mathematische und geometrische Transformationen, befinden sich ebenfalls in der Bibliothek.
# note: Dynamo ist eine visuelle Programmiersprache. Wie bei anderen Sprachen können Sie auch hier einfache Elemente zu komplexeren Ideen verbinden.
# note: Ziehen Sie einen Verbinder aus dem >-Anschluss des Blocks Number, und verbinden Sie ihn mit dem y-Anschluss des +-Blocks, und klicken Sie dann auf die Schaltfläche Ausführen in der linken unteren Ecke der Anwendung.
number = DoubleInput(2)  # graph input
add = number + _  # unwired: y
# note: Daten können durch Klicken auf die Schaltfläche Ausführen rechts unten in der Anwendung visualisiert werden. Wenn Sie den Ausführungsmodus Automatisch aktivieren, wird die Anwendung laufend aktualisiert.
# Sie können die Daten entweder mithilfe eines Watch-Blocks oder durch Klicken auf das kleine Quadrat unten in den meisten Blöcken anzeigen.
watch = Watch(add)
# note: Weitere Beispiele finden Sie im Menü Hilfe. Sie können auch diese Datei über das X auf der Registerkarte schließen, um zur Begrüßungsseite zurückzukehren.
number_2 = DoubleInput(6)  # graph input
