# Dynamo graph Basics_Basic02.dyn (Dynamo 2.19.3.6543)
# author: Dynamo Team
# Linie durch Verbinden von zwei Punkten erstellen

# note: Ändern Sie die Position des Punkts in der Dynamo-Umgebung: Wählen Sie den Point.ByCoordinates-Block aus, und wechseln Sie zur Hintergrundvorschau, um den Punkt entlang seiner drei Achsen zu ziehen.
byCoordinates = Point.ByCoordinates()
# note: Geometrische Daten können entweder als Textinformationen oder im 3D-Raum visualisiert werden.
watch = Watch(byCoordinates)
number = DoubleInput(2)  # graph input
# note: Verwenden Sie einen Number Slider- oder Integer Slider-Block, um einen Wert innerhalb eines angegebenen Bereichs dynamisch einzugeben. Klicken Sie auf den blauen Dropdown-Pfeil, um die Einstellungen für den numerischen Bereich zu öffnen
number_slider = DoubleSlider(4.43, range=0..10 step 0.1)  # graph input
# note: Sie können mithilfe der Schaltflächen rechts oben auf dem Bildschirm zwischen 3D-Hintergrundnavigation und Navigation in der Diagrammansicht wechseln (Tastaturbefehl Strg+B). Darüber hinaus kann die Hintergrundvorschau für Dynamo und Revit über das Menü Ansicht aktiviert und deaktiviert werden.
byCoordinates_2 = Point.ByCoordinates(x=number, z=number_slider)
byStartPointEndPoint = Line.ByStartPointEndPoint(startPoint=byCoordinates_2, endPoint=byCoordinates)
# note: 3D-Watch-Block verwenden, um das 3D-Element isoliert darzustellen
watch_3d = Watch3D(byStartPointEndPoint)
