# Dynamo graph Basics_Basic03.dyn (Dynamo 2.19.3.6543)
# author: Dynamo Team
# Einfache Liste erstellen

# group: Eingaben
# note: Listen mit Daten können mit Folgen und Bereichen erstellt werden. Diese Listen können für bestimmte Zwecke mit zahlreichen anderen Blöcken neu organisiert werden
number = DoubleInput(0)  # graph input
number_2 = DoubleInput(9)  # graph input
number_3 = DoubleInput(1)  # graph input

# note: Folge von Zahlen erstellen, die mit einem angegebenen Step von Start bis End verläuft
range = Range(start=number, end=number_2, step=number_3, lacing=Longest)
watch = Watch(range)
number_4 = DoubleInput(3)  # graph input
# note: Liste in Längen von 3 segmentieren
chop = List.Chop(list=range, lengths=number_4)
# note: Vorschau des Ergebnisses anzeigen und die Listenstruktur mithilfe eines Watch-Blocks beobachten
watch_2 = Watch(chop)
# note: Letztes Element in einer Liste abrufen
lastItem = List.LastItem(list=range)
watch_3 = Watch(lastItem)
