# Dynamo graph Core_AttractorPoint.dyn (Dynamo 3.0.0.6964)
# author: Dynamo Team
# Mit diesem Diagramm wird ein Raster mit Zylindern erstellt, bei dem Größen nach der Position eines Attraktorpunkts bestimmt werden.

# group: Info
# note: ATTRAKTORPUNKT
# Ein Attraktorpunkt ist ein Referenzpunkt (oder Element), der die Eigenschaften anderer Elemente in einem System beeinflusst. Ein Attraktorpunkt funktioniert häufig wie ein Magnet: Je näher sich das Element am Attraktor befindet, desto stärker ist der Einfluss des Attraktors.
# In diesem Beispiel werden Höhe und Durchmesser der Zylinder durch den Abstand zwischen jedem Zylinder und dem sich bewegenden Attraktorpunkt bestimmt. Zylinder um den Attraktorpunkt sind kleiner als die weiter entfernten.
# Um dieses Verhalten zu visualisieren, verschieben Sie die beiden Zahlen-Schieberegler der Attraktorpunkteingabe.
# Attraktorpunkte bieten eine Möglichkeit, dem Entwurfsprozess ein dynamisches Verhalten und ein hohes Maß an Reaktionsfähigkeit zu verleihen.

# group: Punktrastergröße
# note: Verwenden Sie einen Codeblock, um eine Folge von Zahlen zu erstellen. In diesem Fall wird eine Folge mit Zahlen von 1 bis 50 mit n Schritten erstellt, wobei jeder Schritt 5 lautet
zahlenbereich = CodeBlock { 1..50..5; }

# group: Raster mit Punkten erstellen
# note: Raster mit Punkten.
# Übergeben Sie zum Erstellen eine Reihe von Zahlen an zwei Anschlüsse - X- und Y-Koordinaten. Klicken Sie mit der rechten Maustaste auf den Block, und ändern Sie die Vergitterung in Kartesisches Produkt
# note: Die kartesische Produktvergitterung eines Blocks kombiniert die einzelnen Elemente aus einer Liste mit den einzelnen Elementen aus jeder anderen Liste. Dies führt zu einer rasterähnlichen Struktur von Listen.
# Bei Verwendung mit X- und Y-Eingaben des Blocks 'Point.ByCoordinates' entsteht ein flaches Raster mit Punkten. Bei Verwendung der dritten, d. h. der Z-Koordinate entsteht ein würfelförmiges Raster mit Punkten.
byCoordinates = Point.ByCoordinates(x=zahlenbereich, y=zahlenbereich, lacing=CrossProduct)

# group: Listenstruktur vereinfachen
# Eine komplexe Listenstruktur ist für weitere Aktionen mit den Punkten nicht erforderlich. Verwenden Sie Flatten, um nur eine Liste zu erstellen.
# note: Vereinfachen Sie die Liste, da die Hierarchie der Zeilen und Spalten nicht benötigt wird. Vergleichen Sie die Eingabe für diesen Block mit der Ausgabe - die Struktur von N Listen wurde in nur eine Liste geändert.
flatten = List.Flatten(list=byCoordinates)

# group: Position des Attraktorpunkts
number_slider = DoubleSlider(24.6, range=-10..60 step 0.1)  # graph input
number_slider_2 = DoubleSlider(11.50111001, range=-10..60 step 0.1)  # graph input
# note: Attraktorpunkt. Mithilfe der Schieberegler für die Eingabe können Sie die Position dieses Punkts anpassen.
byCoordinates_2 = Point.ByCoordinates(x=number_slider, y=number_slider_2)

# group: Abstand zum Attraktor
# note: Ermittelt den Abstand zwischen dem Attraktorpunkt und jedem Basispunkt der Zylinder
distanceTo = Geometry.DistanceTo(geometry=flatten, other=byCoordinates_2)

# group: Radien und Höhen erstellen
# note: Formel, mit der die Höhe der Zylinder auf die Position des Attraktorpunkts reagiert. In diesem Beispiel beträgt die Höhe jedes Zylinders die Hälfte des Abstands zum Attraktorpunkt. Versuchen Sie es mit einer anderen Formel.
zylinderhöhe = CodeBlock(x=distanceTo) { x/2; }
# note: Eine Formel gibt einen Wert zurück, der als Radius des Zylinders verwendet werden soll. Je größer der Abstand, desto größer der Radius jedes Zylinders. Versuchen Sie es mit einer anderen Formel.
zylinderradius = CodeBlock(x=distanceTo) { x/15; }

# group: Endpunkte
# (Ursprünglichen) Startpunkt jedes Zylinders mit einer bestimmten Höhe, definiert durch die Formel, verschieben
# note: Vektor, um den (ursprünglichen) Basispunkt um einen bestimmten Wert nach oben zu verschieben
byCoordinates_3 = Vector.ByCoordinates(z=zylinderhöhe)
# note: Fügen Sie diesen neuen Z-Wert (Höhe) den ursprünglichen Rasterpunkten hinzu, um die oberen Punkte für die Zylinder abzurufen.
add = Point.Add(point=flatten, vectorToAdd=byCoordinates_3)

# group: Zylinder erstellen
# note: Methode verwenden, mit der ein Zylinder mit einem bestimmten Start- und Endpunkt und Radius erstellt wird
byPointsRadius = Cylinder.ByPointsRadius(startPoint=flatten, endPoint=add, radius=zylinderradius)
