# Dynamo graph Core_CodeBlocks.dyn (Dynamo 3.4.1.7055)
# author: Dynamo Team
# In diesem Diagramm werden verschiedene Verwendungsmöglichkeiten und Anwendungen von Codeblöcken dargestellt

# group: Info
# note: CODEBLÖCKE
# Codeblöcke können durch Doppelklicken in den Ansichtsbereich erstellt werden. Ein Codeblock ist auch in der Blockbibliothek unter der Kategorie Script > Editor zu finden.
# Codeblöcke können Folgendes enthalten:
# •   Numerische Werte (Ganzzahlen und Gleitkommazahlen)
# •  Zeichenfolgen (Text)
# •  Boolesche Werte (True oder False)
# •  Listen [0,1,2]
# •  Ausdrücke (a+3)
# •  Variablen
# Andere Blöcke können in einen Codeblock-Ausdruck umgewandelt werden: Wählen Sie einen oder mehrere Blöcke aus, und klicken Sie mit der rechten Maustaste in den Bereich zwischen den Blöcken, um Block zu Code auszuwählen. Es gibt keine umgekehrte Entsprechung zu dieser Aktion: Codeblöcke können nicht automatisch in Blöcke umgewandelt werden.

# group: Blöcke als Codeblöcke
# note: Codeblöcke können verwendet werden, um einen beliebigen anderen Block in der Bibliothek aufzurufen. Blöcke in der Bibliothek weisen im Allgemeinen drei Typen auf:
#     Erstellen:	Objekt erstellen
#     Aktion:	Aktion für ein Objekt ausführen
#     Abfrage:	Eigenschaft von einem Objekt		abrufen, das bereits existiert
# Methoden oder Blöcke dieser drei Typen werden unterschiedlich behandelt, wenn sie in einem Codeblock aufgerufen werden.

# group: Geometrieerstellung
# note: Diese Anweisungen bilden zusammen einen Algorithmus, der eine schraubenförmige Kurve an einem Basispunkt erstellt.
code_block = CodeBlock()
# ---------- code_block.designscript (16 lines) ----------
// Basic inputs
base = Point.ByCoordinates(3,3);
coils = 3;
height = 5;
rad = 0.5;

// Make a series of points
numPts = 8*coils + 1;
seq = 0..(coils*360)..#numPts;
x = rad * Math.Cos(seq);
y = rad * Math.Sin(seq);
z = 0..height..#numPts;
pts = Point.ByCoordinates(x + base.X, y + base.Y, z + base.Z);

// Pass a curve through those points
NurbsCurve.ByPoints(pts);
# ----------------------------------------
# note: Zum Transformieren des Schraubenalgorithmus in eine Funktion müssen Sie ihm einen Namen zuweisen, die Eingabewerte angeben und festlegen, was zurückgegeben werden soll.
code_block_2 = CodeBlock()
# ---------- code_block_2.designscript (13 lines) ----------
def MakeSpring(base,coils,height,rad)
{
// Make a series of points
numPts = 8*coils + 1;
seq = 0..(coils*360)..#numPts;
x = rad * Math.Cos(seq);
y = rad * Math.Sin(seq);
z = 0..height..#numPts;
pts = Point.ByCoordinates(x + base.X, y + base.Y, z + base.Z);

// Return the curve that passes through those points
return = NurbsCurve.ByPoints(pts);
};
# ----------------------------------------
code_block_3 = CodeBlock { 0..6..2; }
code_block_4 = CodeBlock { 10..20..2; }
# note: Der Algorithmus für die Schraubenform wird transformiert, um eine Funktion mit dem beliebigen Namen "MakeSpring" zu definieren. Mithilfe dieser Funktion werden mehrere Spiralfedern von zufälliger Höhe erstellt und in einem Raster angeordnet.
# note: Erstellt eine Rasterlinie.
byCoordinates = Point.ByCoordinates(x=code_block_3, y=code_block_4, lacing=CrossProduct)
flatten = List.Flatten(list=byCoordinates)
code_block_5 = CodeBlock { 5; }
count = List.Count(list=flatten)
# note: Erstellt eine Reihe zufälliger Zahlen (skaliert um 5) für die Höhen der Federn.
randomList = Math.RandomList(amount=count)
code_block_6 = CodeBlock(random=randomList) { random * 5; }
# note: Die Eingabe in Funktionsaufrufe ist möglich über Listen von Elementen oder Elemente mit Einzelwerten. Die Daten können über Anschlüsse übergeben oder direkt deklariert werden, z. B. bei der Angabe von 0.5 als Radius aller Federn.
code_block_7 = CodeBlock(basePoints=flatten, numCoils=code_block_5, height=code_block_6) { MakeSpring(basePoints,numCoils,height,0.5); }

# group: Funktionen
# note: Funktionen können direkt in einem Codeblock-Block definiert werden, damit sie an anderer Stelle in dieser Definition aufgerufen werden können.
# Die erste Zeile enthält das Schlüsselwort "def", den Namen der Funktion und die Eingaben in Klammern.
# Der Inhalt der Funktion wird in geschweiften Klammern angegeben. Jede Zeile muss mit einem Semikolon enden.
# Geben Sie für die Werterückgabe "return =" an.
code_block_8 = CodeBlock()
# ---------- code_block_8.designscript (11 lines) ----------
/* This is a multi-line comment,
     which continues for mulitple
     lines. */

def FunctionName(input1, input2)
{
// This is a comment
sum = input1 + input2;

return = sum;
};
# ----------------------------------------
code_block_9 = CodeBlock { 1; }
# note: Codeblock-Blöcke, die eine Funktion definieren, verfügen nicht über Eingabe- oder Ausgabeanschlüsse, da sie über andere Codeblock-Blöcke aufgerufen werden.
code_block_10 = CodeBlock { 2; }
# note: Sie können die Funktion über einen anderen Codeblock-Block in derselben Datei aufrufen, indem Sie denselben Namen und dieselbe Anzahl Argumente angeben.
code_block_11 = CodeBlock(in1=code_block_9, in2=code_block_10) { FunctionName(in1,in2); }
watch = Watch(code_block_11)
code_block_12 = CodeBlock { "cat"; }
code_block_13 = CodeBlock { "dog"; }
# note: Der Typ der Eingabeargumente wird nicht in der Definition der Funktion angegeben; diese verarbeitet also beliebige eingehende Daten.
code_block_14 = CodeBlock(in1=code_block_12, in2=code_block_13) { FunctionName(in1,in2); }
watch_2 = Watch(code_block_14)
origin = Point.Origin()
code_block_15 = CodeBlock { 16; }
# note: Wird die Funktion mit Eingaben aufgerufen, die für sie ungeeignet sind, gibt sie das Ergebnis Null zurück.
code_block_16 = CodeBlock(in1=origin, in2=code_block_15) { FunctionName(in1,in2); }
watch_3 = Watch(code_block_16)

# group: Numerische Werte
# Speziell entwickelte Blöcke mit Code Block vergleichen
# note: Speziell entwickelt
number = DoubleInput(3.14)
ergebnis = Watch(number)
# note: Codeblock
code_block_17 = CodeBlock { 3.140; }
watch_4 = Watch(code_block_17)

# group: Zeichenfolgenwerte
# Speziell entwickelte Blöcke mit Code Block vergleichen
# note: Speziell entwickelt
string = StringInput("Less is more.")
ergebnis_2 = Watch(string)
# note: Anführungszeichen ("") verwenden, um eine Zeichenfolge mit einem Codeblock-Block zu erstellen
code_block_18 = CodeBlock { "Less is more."; }
watch_5 = Watch(code_block_18)
# note: Diesen Block verwenden, um den Typ des Ausgabewerts anzuzeigen
type = Object.Type(object=code_block_18)
watch_6 = Watch(type)

# group: Ausdrücke
# Multiplikationsvorgang mit einem speziell entwickelten *-Block und mithilfe von Code Block durchführen
number_2 = DoubleInput(3)
number_3 = DoubleInput(5)
# note: Zwei Zahlen mit dem *-Block multiplizieren
mul = number_2 * number_3
ergebnis_3 = Watch(mul)
# note: Multiplikation mit einem Codeblock durchführen
code_block_19 = CodeBlock { 3*5; }
watch_7 = Watch(code_block_19)
code_block_20 = CodeBlock { 3; }
code_block_21 = CodeBlock { 5; }
# note: Verwenden Sie Variablen als Eingaben für den Multiplikationsvorgang.
code_block_22 = CodeBlock(a=code_block_20, b=code_block_21) { a*b; }
watch_8 = Watch(code_block_22)

# group: Abfrage
# Methoden, die eine Eigenschaft eines Objekts abfragen und zurückgeben
# note: Codeblöcke geben dem Benutzer die Möglichkeit, flexibel zu entscheiden, wie Eingaben angegeben werden sollen. Hier werden einige verschiedene Möglichkeiten zum Erstellen desselben Punkts gezeigt.
code_block_23 = CodeBlock { 10; }
code_block_24 = CodeBlock { -10; }
# note: Vordefinierte Methode unter Verwendung des Blocks Point.ByCoordinates
byCoordinates_2 = Point.ByCoordinates(x=code_block_23, y=code_block_24)
watch_9 = Watch(byCoordinates_2)
# note: Code Block verwendet eine Point.ByCoordinates-Methode mit drei Variablen für X, Y und Z, wobei Z im gleichen Codeblock definiert und durch ein Semikolon ';'getrennt wird
code_block_25 = CodeBlock(x=code_block_23, y=code_block_24) { z = 0; Point.ByCoordinates(x,y,z); }
watch_10 = Watch(code_block_25.out1)
code_block_26 = CodeBlock { Point.ByCoordinates(10,0,0); }
# note: Code Block-Entsprechung der gleichen Methode. Abfragemethoden erfordern keine Klammern
code_block_27 = CodeBlock(pt=code_block_26) { pt.X; }
watch_11 = Watch(code_block_27)
# note: Vordefinierte Abfragemethode, die die X-Koordinate des Punkts zurückgibt
X = Point.X(point=code_block_26)
watch_12 = Watch(X)
# note: Eine Formel zur Verwendung eines negativen Werts desselben numerischen Werts wird hier in die Notation für Eingabevariablen integriert
code_block_28 = CodeBlock(num=code_block_23) { Point.ByCoordinates(num,-num,0); }
watch_13 = Watch(code_block_28)
# note: Code Block verwendet eine Point.ByCoordinates-Methode; alle drei Variablen werden als Eingabe bereitgestellt
code_block_29 = CodeBlock { Point.ByCoordinates(10,-10,0); }
watch_14 = Watch(code_block_29)

# group: Erstellen
# Methoden zum Erstellen von Geometrie, Listen, Revit-Elementen oder anderen Objekten
# note: Vordefinierte Methode zum Erstellen eines Punkts am Ursprung
origin_2 = Point.Origin()
watch_15 = Watch(origin_2)
# note: Obwohl für diese Methode keine Eingaben erforderlich sind, werden die Klammern benötigt
code_block_30 = CodeBlock { Point.Origin(); }
watch_16 = Watch(code_block_30)
code_block_31 = CodeBlock { 0; -10; }
# note: Vordefinierte Methode zur Punkterstellung durch Angabe von X- und Y-Koordinaten
byCoordinates_3 = Point.ByCoordinates(x=code_block_31.out0, y=code_block_31.out1)
watch_17 = Watch(byCoordinates_3)
# note: Verwenden Sie einen Codeblock, um das Verhalten des Blocks Point.ByCoordinates zu replizieren. Sie finden den Namen der Methode, wenn Sie den Mauszeiger über den ursprünglichen vordefinierten Block bewegen: Die Methode wird unten im QuickInfo-Fenster erwähnt.
# Die Eingaben müssen in der Reihenfolge angegeben werden, die im vordefinierten Block angegeben ist.
code_block_32 = CodeBlock { Point.ByCoordinates(0,-10); }
watch_18 = Watch(code_block_32)

# group: Aktion
# Methoden, die eine Aktion für ein Objekt ausführen
origin_3 = Point.Origin()
ZAxis = Vector.ZAxis()
# note: Vordefinierte Methode zum Hinzufügen eines Vektors zu einem Punkt
add = Point.Add(point=origin_3, vectorToAdd=ZAxis)
watch_19 = Watch(add)
origin_4 = Point.Origin()
ZAxis_2 = Vector.ZAxis()
# note: Aktionsmethoden werden für ein Objekt ausgeführt. Verwenden Sie die Punktnotation nach dem Objekt selbst, und geben Sie die Methode und alle Eingaben an, die im vordefinierten Block existieren, mit Ausnahme der ersten (da der erste Eingabeanschluss das Objekt selbst ist, das bereits vorhanden ist)
code_block_33 = CodeBlock(pt=origin_4, vector=ZAxis_2) { pt.Add(vector); }
watch_20 = Watch(code_block_33)

# group: Listen erstellen
# note: Listen erstellen, indem die Liste mithilfe von eckigen Klammern definiert und die einzelnen Elemente durch Kommas getrennt werden
code_block_34 = CodeBlock { ["San Francisco","New York","Chicago"]; }
watch_21 = Watch(code_block_34)
# note: Rufen Sie Elemente mithilfe der folgenden Notation aus einer Liste ab: list [ i ], wobei i der Index des Elements ist. Diese Methode entspricht der Verwendung des Blocks GetItemAtIndex
code_block_35 = CodeBlock(cities=watch_21) { cities[2]; }
watch_22 = Watch(code_block_35)
# note: In diesem Codeblock werden mehrere Variablen definiert, und am Ende wird eine Liste mit allen Variablen erstellt.
code_block_36 = CodeBlock()
# ---------- code_block_36.designscript (7 lines) ----------
str0 = "alpha";
str1 = "beta";
str2 = "charlie";
str3 = "delta";
str4 = "echo";
//
[str0,str1,str2,str3,str4];
# ----------------------------------------
watch_23 = Watch(code_block_36.out5)
code_block_37 = CodeBlock(phonetic=watch_23) { phonetic[2..3]; }
watch_24 = Watch(code_block_37)
code_block_38 = CodeBlock { 2; }
getItemAtIndex = List.GetItemAtIndex(list=watch_21, index=code_block_38)
watch_25 = Watch(getItemAtIndex)

# group: Listen kombinieren und auf Listenelemente zugreifen
# Beschreibung <Hier doppelklicken, um die Gruppenbeschreibung zu bearbeiten>
# note: Erstellt verschachtelte Listen und ruft Elemente aus verschachtelten Listen ab.
code_block_39 = CodeBlock()
# ---------- code_block_39.designscript (6 lines) ----------
kitchen = ["table","stove","sink","refrigerator"];
livingRoom = ["sofa","books"];
bedroom = ["bed","dirty clothes"];
bathroom = ["tooth brush"];
//
allMyStuff = [kitchen, livingRoom, bedroom, bathroom];
# ----------------------------------------
watch_26 = Watch(code_block_39.allMyStuff)
# note: Auf das zweite Element in der dritten Liste zugreifen (oder mit anderen Worten: auf das Element mit Index '1' in der Liste mit Index '2' zugreifen)
code_block_40 = CodeBlock(list=watch_26) { list[2][1]; }
watch_27 = Watch(code_block_40)

# group: Replikation
# note: Replikationsanleitungen können dazu verwendet werden, festzulegen, dass Listen als Kartesisches Produkt vergittert werden.
code_block_41 = CodeBlock { x_vals = 0..10; y_vals = -30..-40; }
code_block_42 = CodeBlock(x_vals=code_block_41.x_vals, y_vals=code_block_41.y_vals) { Point.ByCoordinates(x_vals, y_vals); }
code_block_43 = CodeBlock { x_vals = 0..10; y_vals = -15..-25; }
code_block_44 = CodeBlock(x_vals=code_block_43.x_vals, y_vals=code_block_43.y_vals) { Point.ByCoordinates(x_vals<1>, y_vals<2>); }
byCoordinates_4 = Point.ByCoordinates(x=code_block_41.x_vals, y=code_block_41.y_vals)
byCoordinates_5 = Point.ByCoordinates(x=code_block_43.x_vals, y=code_block_43.y_vals, lacing=CrossProduct)
# note: Replikationsanleitungen (in denen spitze Klammern verwendet werden) übernehmen zwei oder drei eindimensionale Sammlungen und ordnen deren Elemente einander zu, sodass eine einzelne ein-, zwei- oder dreidimensionale Sammlung entsteht.
# note: In diesem Beispiel sind 2 X- und 5 Y-Werte vorhanden. In Replikationsanleitungen können Sie festlegen, dass die resultierende Kombination aus 2 Listen mit 5 Einträgen oder aus 5 Listen mit 2 Einträgen bestehen soll.
code_block_45 = CodeBlock()
# ---------- code_block_45.designscript (5 lines) ----------
x_vals = 0..1;
y_vals = -3..-7;
//
Point.ByCoordinates(x_vals<1>, y_vals<2>);
Point.ByCoordinates(x_vals<2>, y_vals<1>);
# ----------------------------------------
watch_28 = Watch(code_block_45.out2)
watch_29 = Watch(code_block_45.out3)

# group: Boolesch
# Speziell entwickelte Blöcke mit Code Block vergleichen
# note: Boolescher Umschaltblock
boolean = BoolSelector(true)
watch_30 = Watch(boolean)
# note: 'True'- oder 'False'-Werte in einem Codeblock verwenden, um dasselbe Ergebnis zu erzielen
code_block_46 = CodeBlock { true; }
watch_31 = Watch(code_block_46)
