# Dynamo graph Core_ListAtLevel.dyn (Dynamo 3.1.0.3411)
# author: Dynamo Team
# Wir untersuchen List@Level und wie damit die gleichen Ergebnisse wie mit dem Block List.Map erzielt werden können. Wir erstellen eine Reihe von Gruppen, um zu zeigen, wie List@Level wirklich funktioniert.

# group: Info
# note: Um zu bestimmen, mit welcher Ebene der Liste Sie arbeiten möchten, folgen Sie im unteren Bereich des Vorschaufensters oder Watch-Blocks den Linien ausgehend von der List@Level-Notation nach oben.

# group: Info
# Allgemeine Informationen zur Verwendung von List@Level
# note: LIST@LEVEL
# Die Funktion List@Level ersetzt die Funktion von List.Map, indem Sie direkt die Ebene der Liste auswählen können, mit der Sie arbeiten möchten.
# note: Um die Listenebene zu ändern, mit der Sie arbeiten möchten, klicken Sie auf den Pfeil neben dem Eingabeanschluss der Liste und aktivieren Sie die Option Ebenen verwenden.
# Wenn List@Level zum ersten Mal auf einem Eingabeanschluss aktiviert wird, wird die Liste an der zweiten innersten Ebene (E2) als Arbeitsliste ausgewählt.

# group: Info
# Funktionsweise dieses Diagramms
# note: Wir möchten Gruppen im Inneren des Rasters erstellen. Dazu müssen wir die Punkte auf den Indizes 1 und 2 jeder Liste in der innersten Ebene erfassen. Dafür kann einfach die Funktion List@Level verwendet werden. Die Gruppierung der Listen wird durch Aktivieren der Option Listenstruktur beibehalten beibehalten. Schauen wir uns aber zunächst die Liste, die wir mit Point.ByCoordinates erstellt haben, etwas genauer an, um festzulegen, welche Ebene der Liste wir verwenden möchten.

# group: Eingaben
# Beschreibung <Hier doppelklicken, um die Gruppenbeschreibung zu bearbeiten>
code_block = CodeBlock { 0..30..#8; 12..0..#4; }
# note: In diesem Beispiel erstellen wir eine 3D-Liste mit einer Reihe von Punkten. Es gibt acht Listen auf E3 mit je vier weiteren Listen (E2). Jede der vier Listen enthält vier Punkte (E1), sodass sich insgesamt 128 Punkte ergeben.
byCoordinates = Point.ByCoordinates(x=code_block.out0, y=code_block.out1, z=code_block.out1, lacing=CrossProduct)

# group: List.Map-Block mit der List@Level ersetzen.
code_block_2 = CodeBlock { [1,2]; }
# note: In der vorherigen Version von Dynamo wurde List.Map zur Ermittlung der inneren Ebenen von Listen verwendet. Auch wenn mithilfe von List.Map dasselbe Ergebnis erzielt werden kann, werden jedoch mehr Blöcke in den Arbeitsbereich eingeführt. Hier verwenden wir List@Level, um Innenpunkte des Rasters wesentlich effizienter zu erfassen. Anhand dieser Punkte können Gruppen erstellt werden.
# Wir verwendeten auch die Option Listenstruktur beibehalten, um die Gruppierung der ursprünglichen Liste beizubehalten und ein Abflachen zu verhindern. Wenn Listenstruktur beibehalten deaktiviert ist, wird nur eine NURBS-Fläche anstelle von acht erstellt.
getItemAtIndex = List.GetItemAtIndex(list=byCoordinates@@L2, index=code_block_2)
code_block_3 = CodeBlock { [1,2]; }
# note: Die Listen befinden sich auf unterschiedlichen Ebenen, E1 ist dabei die unterste Ebene. Insgesamt werden von diesem Block 64 Elemente produziert, wie unten gezeigt.
getItemAtIndex_2 = List.GetItemAtIndex(index=code_block_3)  # unwired: list
# note: Im Folgenden finden Sie die Entsprechung von List.Map zur Anwendung von List@Level. Dafür sind zusätzliche Blöcke erforderlich.
map = List.Map(f_x=getItemAtIndex_2)  # unwired: list
map_2 = List.Map(list=byCoordinates, f_x=map)

# group: Erstellen von Geometrie
# note: Mit dem ausgewählten Satz von Punkten können Sie nun Gruppen erstellen.
byPoints = NurbsSurface.ByPoints(points=getItemAtIndex)
byBestFitThroughPoints = Line.ByBestFitThroughPoints(bestFitPoints=getItemAtIndex)

# group: Prüfen einer Liste mit List@Level und Count
# note: Der Block List.Count gibt die Anzahl der Elemente zurück, die in den einzelnen Listen enthalten sind. Je nach ausgewählter Ebene werden verschiedene Werte zurückgegeben. Ändern Sie den Wert von E3, indem Sie auf die Pfeile daneben klicken.
# note: Auf E3 gibt es acht Listen mit jeweils vier Listen. Daher wird mit Auswahl von E3 die Funktion List.Count für acht Listen implementiert, sodass sich acht '4' -Werte ergeben.
count = List.Count(list=byCoordinates@L3)

# group: Mit "Listenstruktur beibehalten"
# note: Dieser Block gibt die Anzahl der Elemente in den einzelnen Listen in E2 zurück. Vorgabemäßig werden die Ergebnisse in eine 1D-Liste abgeflacht.
count_2 = List.Count(list=byCoordinates@L2)
# note: Um die verschachtelte Struktur der Liste beizubehalten, wählen Sie die Option"Listenstruktur beibehalten. "@@" gibt an, wie die Listenstruktur in DesignScript beibehalten werden soll.
count_3 = List.Count(list=byCoordinates@@L2)

# group: Prüfen einer Liste mit List@Level und Flatten
# note: Als weiteres Beispiel können Sie die verschachtelte Struktur auf inneren Ebenen der Listen einfach abflachen, indem Sie die Funktion List@Level zusammen mit dem Flatten-Block nutzen. Versuchen Sie, die Ebene zu ändern, die abgeflacht werden soll, indem Sie auf die Pfeile neben dem Auswahlfeld List@Level klicken.
# note: Durch die Auswahl von E3 werden die acht Listen auf dieser Ebene in eine 1D-Anordnung umgewandelt. Da jede der acht Listen vier Elemente enthält (die ebenfalls Listen sind), werden alle Listen auf E3 abgeflacht, sodass acht Listen mit 16 Punkten entstehen.
flatten = List.Flatten(list=byCoordinates@L3)
