# Dynamo graph Core_ListLacing.dyn (Dynamo 3.1.0.3411)
# author: Dynamo Team
# Listenvergitterung - alle Modi der Listenvergitterung werden in diesem Diagramm dargestellt und vorgeführt

# group: Info
# note: Listenvergitterung
# Vergitterung ist die Logik, die von Dynamo-Blöcken zum Zuordnen von Elementen aus unterschiedlichen Listen verwendet wird. Bei den meisten Blöcken in Dynamo können Sie wählen, wie Datenlisten kombiniert werden sollen. Dazu legen Sie das "Vergitterungsverhalten" fest.
# In jedem dieser Beispiele werden zwei Listen von Punkten an den Block Line.ByStartPointEndPoint übergeben. Der Block, der die Linie erstellt, muss entscheiden, wie viele Linien zwischen welchen Punktpaaren gezeichnet werden sollen.
# Um das Vergitterungsverhalten festzulegen, klicken Sie mit der rechten Maustaste auf einen Block mit zwei oder mehr Eingabeanschlüssen und wählen Vergitterung.

# group: Tipp
# note: Tipp: Zeigen Sie bei Blöcken, die Geometrie erstellen, den Elementindex als Bezeichnung in der Hintergrundvorschau an. Klicken Sie mit der rechten Maustaste, und wählen Sie Bezeichnungen anzeigen.

# group: Tipp
# note: Tipp: Das Vergitterungsverhalten eines Blocks wird am Block durch das kleine Symbol in der rechten unteren Ecke ausgedrückt. Wenn kein Symbol zu sehen ist, ist keine Vergitterung für den Block möglich.

# group: Eingaben
# note: Längere Folge (10 Elements)
code_block = CodeBlock { 0..9; }
code_block_2 = CodeBlock { 4; }
# note: Kürzere Folge (6 Elemente)
code_block_3 = CodeBlock { 0..5; }
code_block_4 = CodeBlock { 0..9; }
code_block_5 = CodeBlock { -10; 4; }
code_block_6 = CodeBlock { 0..5; }
code_block_7 = CodeBlock { 0..9; }
code_block_8 = CodeBlock { 10; 4; }
code_block_9 = CodeBlock { 0..5; }

# group: Punkte erstellen
# 2 Punktsätze für (10 x 6) erstellen, die als Eingabe für Line.ByStartPointEndPoint verwendet werden sollen
byCoordinates = Point.ByCoordinates(x=code_block, z=code_block_2)
byCoordinates_2 = Point.ByCoordinates(x=code_block_3)

# group: Längste Vergitterung
# note: Längste Vergitterung
# Es werden so viele Linien gezeichnet, wie Elemente in der längeren Liste mit Eingabepunkten vorhanden sind. Sind alle Punkte in der kürzeren Liste aufgebraucht, ordnet der Block Kopien des letzten Elements den verbleibenden Elementen der längeren Liste zu.
byStartPointEndPoint = Line.ByStartPointEndPoint(startPoint=byCoordinates, endPoint=byCoordinates_2, lacing=Longest)

# group: Punkte erstellen
# 2 Punktsätze für (10 x 6) erstellen, die als Eingabe für Line.ByStartPointEndPoint verwendet werden sollen
byCoordinates_3 = Point.ByCoordinates(x=code_block_4, y=code_block_5.out0, z=code_block_5.out1)
byCoordinates_4 = Point.ByCoordinates(x=code_block_6, y=code_block_5.out0)

# group: Kürzeste Vergitterung
# note: Kürzeste Vergitterung
# Es werden nur so viele Linien gezeichnet, wie Elemente in der kürzesten Eingabeliste vorhanden sind. Übrig bleibende Punkte in der längeren Liste werden nicht berücksichtigt.
byStartPointEndPoint_2 = Line.ByStartPointEndPoint(startPoint=byCoordinates_3, endPoint=byCoordinates_4)

# group: Punkte erstellen
# 2 Punktsätze für (10 x 6) erstellen, die als Eingabe für Line.ByStartPointEndPoint verwendet werden sollen
byCoordinates_5 = Point.ByCoordinates(x=code_block_7, y=code_block_8.out0, z=code_block_8.out1)
byCoordinates_6 = Point.ByCoordinates(x=code_block_9, y=code_block_8.out0)

# group: Kartesisches Produkt - Vergitterung
# note: Kartesisches Produkt - Vergitterung
# Alle möglichen Paare werden erstellt. Sind in der längeren Liste 10 Punkte und in der kürzeren Liste 6 Punkte enthalten, erhalten Sie als Ergebnis 10 x 6 = 60 Linien.
byStartPointEndPoint_3 = Line.ByStartPointEndPoint(startPoint=byCoordinates_5, endPoint=byCoordinates_6, lacing=CrossProduct)
# note: Die resultierenden Linien werden in einer verschachtelten Liste gespeichert, die entweder 6 Listen mit 10 Zeilen oder 10 Listen mit 6 Zeilen enthält, je nachdem, welche Liste zuerst angegeben wurde.
watch = Watch(byStartPointEndPoint_3)
