# Dynamo graph Core_Math.dyn (Dynamo 3.4.1.7055)
# author: Dynamo Team
# Dies ist eine umfassende Darstellung der verschiedenen Mathematikfunktionen und -optionen von Dynamo

# group: Info
# note: MATH
# Mathematische Operationen können in Dynamo mithilfe von Blöcken aus der Math-Bibliothek und der Operators-Bibliothek oder mithilfe eines Codeblocks ausgeführt werden. Weiter unten wird die Ausführung grundlegender mathematischer Operationen mit jeder dieser drei Methoden gezeigt.

# group: Grundlegende arithmetische Operatoren
# note: Arithmetische Operatoren, z.  B.
# +, -, *, /, %

# group: Grundlegende logische Operatoren
# note: Vergleichsoperatoren z. B.
# <, >, <=, >=, !=, ==

# group: Boolesche Operatoren
# note: Boolesche Operatoren
# (Weitere finden Sie in der Bibliothek.)

# group: Rundung
# note: Rundung

# group: Komplexe Mathematikfunktionen
# 4 Beispiele für das Erreichen desselben Endergebnisses mithilfe von Blöcken, Python, Fo
# note: Dieses Beispiel zeigt vier verschiedene Möglichkeiten für den Umgang mit Mathematikfunktionen. Jedes Beispiel geht von einem Raster mit Punkten aus, berechnet Z-Koordinaten für die Punkte und erstellt anschließend eine Oberfläche. Sie unterscheiden sich nur in der Berechnungsmethode; mit allen Methoden wird dieselbe Aufgabe gelöst.
# 1. Blöcke. Blöcke für mathematische Aufgaben befinden sich im Abschnitt Math der Bibliothek, wie wiederum in Funktionen, Logik und Operatoren unterteilt ist.
# 2. Python.
# 3. Codeblock-Block. Doppelklicken Sie in den Ansichtsbereich, um einen Codeblock-Block zu erstellen. Die Syntax der jeweiligen Funktion entspricht dem Namen des Blocks in Dynamo.
# ** Anmerkung: Sie können die Auflösung der Geometrievorschau anpassen, indem Sie zu den Einstellungen für die Rendergenauigkeit navigieren: Dynamo -> Voreinstellungen -> Darstellungseinstellungen -> Rendergenauigkeit
# note: Weitere Informationen zu diesem Beispiel:
# http://dynamobim.org/math-transit/

# group: Bogen
# note: Bogen mit 2 separaten Methoden erstellen, einmal mit Blöcken und einmal mit Codeblöcken. Die Ergebnisse werden zur Verdeutlichung visualisiert

# group: Tipp
# Markieren von Geometrieblöcken
# note: Tipp: Wenn Sie einen Block auswählen, mit dem Geometrie gezeichnet wird, wird die auf diese Weise erstellte Geometrie cyanfarben angezeigt.  Dieser Codeblock zeichnet die Achsen eines Diagramms, die Punkte entlang der Kurve und schließlich die Kurve selbst. Wählen Sie den Codeblock aus, um die gezeichnete Kurve im Hintergrund anzuzeigen.

# group: Kosinuskurve
# note: Diese Beispiele zeigen die Erzeugung eines Diagramms für eine Kosinusfunktion mithilfe von Blöcken und eines Codeblocks.
# In jedem Beispiel wird eine Reihe von Zahlen als X-Werte für eine Reihe von Punkten verwendet, anschließend werden die Y-Werte aus den X-Werten berechnet, und schließlich wird eine Linie in Form einer Kosinuskurve gezeichnet. Der große Codeblock am Ende jedes Diagramms verschiebt die gezeichnete Geometrie an eine andere Stelle des Bildschirms, um Überlappungen zu vermeiden.

# group: Tipp
# Rendergenauigkeit
# note: Tipp: Sie können anpassen, wie präzise die Geometrie in der Hintergrundvorschau gerendert wird. Navigieren Sie dazu zu Dynamo -> Voreinstellungen -> Darstellungseinstellungen -> Rendergenauigkeit. Mit einem höheren Wert wirken gekrümmte Oberflächen glatter, das Zeichnen nimmt jedoch mehr Rechenleistung in Anspruch.

# group: Blöcke > Anfängliche Eingabe für die Liste mit Punkten
code_block = CodeBlock { -10..10..#20; }

# group: Blöcke > Anfängliche Erstellung und Bearbeitung der Punktliste
# note: Erstellt ein Raster von Punkten.
# Beachten Sie, dass als Vergitterungsverhalten
# Kartesisches Produkt festgelegt wurde.
byCoordinates = Point.ByCoordinates(x=code_block, y=code_block, lacing=CrossProduct)
flatten = List.Flatten(list=byCoordinates)
X = Point.X(point=flatten)
Y = Point.Y(point=flatten)

# group: Blöcke > Amplitude
# note: Amplitude
number_slider = DoubleSlider(5.51, range=0..10 step 0.1)  # graph input

# group: Blöcke > Quadrat
number = DoubleInput(2)  # graph input
pow = Math.Pow(number=X, power=number)

# group: Blöcke > Quadrat
number_2 = DoubleInput(2)  # graph input
pow_2 = Math.Pow(number=Y, power=number_2)

# group: Blöcke > Frequenz
# note: Frequenz
number_slider_2 = DoubleSlider(1.724, range=0..6 step 0.1)  # graph input

# group: Blöcke > Quadrat
number_3 = DoubleInput(2)  # graph input
pow_3 = Math.Pow(number=number_slider_2, power=number_3)

# group: Blöcke > Reihe von mathematischen Berechnungen und Bearbeitungen zum Erstellen der Riffel-Geometrie mithilfe von Blöcken
add = pow + pow_2
add_2 = add + pow_3
sqrt = Math.Sqrt(number=add_2)
# note: Winkel werden in Dynamo in Grad angegeben.
radiansToDegrees = Math.RadiansToDegrees(radians=sqrt)
sin = Math.Sin(angle=radiansToDegrees)
div = sin / sqrt
mul = number_slider * div

# group: Blöcke > Resultierende Punkte erfassen und für das endgültige Rendering vorbereiten
byCoordinates_2 = Point.ByCoordinates(x=X, y=Y, z=mul)
# note: Zählt die Anzahl der Punktgruppen aus der ersten Punktsammlung (20x20)
count = List.Count(list=byCoordinates)

# group: Blöcke > Sammlung von Punkten
# note: Unterteilt eine flache Liste in eine Folge
# von Listen nach Zeile.
chop = List.Chop(list=byCoordinates_2, lengths=count)

# group: Blöcke > Kurvennetzwerk
# note: Erstellt NURBS-Kurven
# durch Punkte.
byPoints = NurbsCurve.ByPoints(points=chop)

# group: Blöcke > Endgültige Fläche
# note: Erstellt eine Oberfläche.
byLoft = Surface.ByLoft(crossSections=byPoints)

# group: Codeblock > Anfängliche Eingabe für die Liste mit Punkten
code_block_2 = CodeBlock { -10..10..#20; }

# group: Codeblock > Anfängliche Erstellung und Bearbeitung der Punktliste
byCoordinates_3 = Point.ByCoordinates(x=code_block_2, y=code_block_2, lacing=CrossProduct)
flatten_2 = List.Flatten(list=byCoordinates_3)
Y_2 = Point.Y(point=flatten_2)
X_2 = Point.X(point=flatten_2)

# group: Codeblock > Hilfsfunktion zum Verschieben der Geometrie
# note: Verschiebt die Geometrie
code_block_3 = CodeBlock(x=Y_2) { x+60; }

# group: Codeblock > Frequenz
number_slider_3 = DoubleSlider(1.724, range=0..5 step 0.1)  # graph input

# group: Codeblock > Amplitude
number_slider_4 = DoubleSlider(5.51, range=0..10 step 0.1)  # graph input

# group: Codeblock > Reihe von mathematischen Berechnungen und Bearbeitungen zum Erstellen der Riffel-Geometrie mithilfe von Blöcken
# note: Namen für mathematische Methoden entsprechen den Namen der Dynamo-Blöcke im ersten Beispiel.
code_block_4 = CodeBlock(x=X_2, y=Y_2, c=number_slider_3, A=number_slider_4)
# ---------- code_block_4.designscript (6 lines) ----------
sum = Math.Pow(x,2) + Math.Pow(y,2) + Math.Pow(c,2);

num1 = Math.Sqrt(sum);
num2 = Math.Sin( Math.RadiansToDegrees(num1) );

A * num2 / num1;
# ----------------------------------------

# group: Codeblock > Resultierende Punkte erfassen und für das endgültige Rendering vorbereiten
byCoordinates_4 = Point.ByCoordinates(x=code_block_3, y=X_2, z=code_block_4.out3)
count_2 = List.Count(list=byCoordinates_3)

# group: Codeblock > Sammlung von Punkten
chop_2 = List.Chop(list=byCoordinates_4, lengths=count_2)

# group: Codeblock > Kurvennetzwerk
byPoints_2 = NurbsCurve.ByPoints(points=chop_2)

# group: Codeblock > Endgültige Fläche
byLoft_2 = Surface.ByLoft(crossSections=byPoints_2)

# group: Python > Anfängliche Eingabe für die Liste mit Punkten
code_block_5 = CodeBlock { -10..10..#20; }

# group: Python > Anfängliche Erstellung und Bearbeitung der Punktliste
byCoordinates_5 = Point.ByCoordinates(x=code_block_5, y=code_block_5, lacing=CrossProduct)
flatten_3 = List.Flatten(list=byCoordinates_5)
X_3 = Point.X(point=flatten_3)
Y_3 = Point.Y(point=flatten_3)

# group: Python > Hilfsfunktion zum Verschieben der Geometrie
# note: Verschiebt die Geometrie
code_block_6 = CodeBlock(x=X_3) { x+30; }

# group: Python > Amplitude
number_slider_5 = DoubleSlider(5.51, range=0..10 step 0.1)  # graph input

# group: Python > Frequenz
number_slider_6 = DoubleSlider(1.724, range=0..5 step 0.1)  # graph input

# group: Python > Reihe von mathematischen Berechnungen und Bearbeitungen zum Erstellen der Riffel-Geometrie mithilfe von Blöcken
python_script = Python(Amplitude=number_slider_5, X=X_3, Y=Y_3, Frequency=number_slider_6)  # PythonNet3
# ---------- python_script.python (27 lines) ----------
import clr
clr.AddReference('ProtoGeometry')
from Autodesk.DesignScript.Geometry import *

import math

# The inputs to this node will be stored as a list in the IN variable.
amp = IN[0]   # single value
x = IN[1]     # list
y = IN[2]     # list (expect same length as x)
c = IN[3]     # single value

# Declare an empty array of z-values
z = []

# Solve the equation for each x and y value
for index in range(len(x)):
	sum = math.pow(x[index],2) + math.pow(y[index],2) + math.pow(c,2)
	num1 = math.sqrt(sum)
	num2 = math.sin(num1)
	zVal = amp * num2 / num1
	
	# Append the answer to the list of z values
	z.append(zVal)

# Assign the z-values to the OUT variable
OUT = z
# ----------------------------------------

# group: Python > Resultierende Punkte erfassen und für das endgültige Rendering vorbereiten
byCoordinates_6 = Point.ByCoordinates(x=code_block_6, y=Y_3, z=python_script)
count_3 = List.Count(list=byCoordinates_5)

# group: Python > Sammlung von Punkten
chop_3 = List.Chop(list=byCoordinates_6, lengths=count_3)

# group: Python > Kurvennetzwerk
byPoints_3 = NurbsCurve.ByPoints(points=chop_3)

# group: Python > Endgültige Fläche
byLoft_3 = Surface.ByLoft(crossSections=byPoints_3)

# group: Kosinuskurve mithilfe von Codeblöcken > Eingaben
# note: Basiskoordinatenpunkt
code_block_7 = CodeBlock { 25; 20; }
# note: Folge von X-Werten
code_block_8 = CodeBlock { 0..10..#20; }
# note: Amplitude
number_slider_7 = DoubleSlider(3, range=0..10 step 0.1)  # graph input
# note: Frequenz
number_slider_8 = DoubleSlider(36, range=0..100 step 0.1)  # graph input

# group: Kosinuskurve mithilfe von Codeblöcken > Kosinuskurvenfunktion
# Kosinuswert für die angegebene Frequenz und den Winkel abrufen und mit der Amplitude multiplizieren
code_block_9 = CodeBlock(amplitude=number_slider_7, frequency=number_slider_8, angle=code_block_8) { amplitude * Math.Cos(frequency * angle); }

# group: Kosinuskurve mithilfe von Codeblöcken > Zwischenvorgänge
byCoordinates_7 = Point.ByCoordinates(x=code_block_7.out0, y=code_block_7.out1)
byCoordinates_8 = Point.ByCoordinates(x=code_block_8, y=code_block_9)

# group: Kosinuskurve mithilfe von Codeblöcken > Kosinuskurve erstellen und visualisieren
code_block_10 = CodeBlock(base=byCoordinates_7, pts=byCoordinates_8)
# ---------- code_block_10.designscript (14 lines) ----------
// Make axes from base point
dimension = 10;
top = Point.ByCoordinates(base.X, base.Y + dimension/2);
bottom = Point.ByCoordinates(base.X, base.Y - dimension/2);
right = Point.ByCoordinates(base.X + 10, base.Y);
Line.ByStartPointEndPoint(bottom, top);
Line.ByStartPointEndPoint(base, right);

// Move function results to base point
vec = base.AsVector();
newPts = pts.Add(vec);

// Draw a line through the points
NurbsCurve.ByPoints(newPts);
# ----------------------------------------

# group: Kosinuskurve mithilfe von Blöcken > Eingaben
# note: X- und Y-Koordinaten des Basispunkts
code_block_11 = CodeBlock { -5; 20; }
# note: Folge von X-Werten
code_block_12 = CodeBlock { 0..10..#20; }
# note: Frequenz
number_slider_9 = DoubleSlider(36, range=0..100 step 0.1)  # graph input

# group: Kosinuskurve mithilfe von Blöcken > Steuert die Amplitude
# note: Amplitude
number_slider_10 = DoubleSlider(3, range=0..10 step 0.1)  # graph input

# group: Kosinuskurve mithilfe von Blöcken
mul_2 = number_slider_9 * code_block_12

# group: Kosinuskurve mithilfe von Blöcken > Funktion Math.Cos
# Kosinuswert für jede anfängliche Zahl abrufen
cos = Math.Cos(angle=mul_2)

# group (continued): Kosinuskurve mithilfe von Blöcken
mul_3 = number_slider_10 * cos

# group: Kosinuskurve mithilfe von Blöcken > Zwischenvorgänge
byCoordinates_9 = Point.ByCoordinates(x=code_block_11.out0, y=code_block_11.out1)
# note: Tipp: Sie können die Vorschaufunktion für beliebige Blöcke, die Geometrie erstellen, aktivieren oder deaktivieren. Klicken Sie mit der rechten Maustaste, und aktivieren oder deaktivieren Sie die Option Vorschau.
byCoordinates_10 = Point.ByCoordinates(x=code_block_12, y=mul_3)

# group: Kosinuskurve mithilfe von Blöcken > Kosinuskurve erstellen und visualisieren
code_block_13 = CodeBlock(base=byCoordinates_9, pts=byCoordinates_10)  # same code as code_block_10

# group: Bogen mithilfe von Blöcken > Eingaben
# Erstellen Sie die erforderlichen Eingaben:
# 1. Mittelpunkt
# 2. Radius
# 3. Startwinkel
# 4. Endwinkel
# 5. Normale (Z-Achse)
code_block_14 = CodeBlock { 0; 35; }
byCoordinates_11 = Point.ByCoordinates(x=code_block_14.out0, y=code_block_14.out1)
code_block_15 = CodeBlock { 5; 0; }
# note: Durch Ziehen des Schiebereglers ändern Sie die Länge des Bogens.
number_slider_11 = DoubleSlider(247.821, range=0..360 step 0.1)  # graph input
ZAxis = Vector.ZAxis()

# group: Bogen mithilfe von Blöcken > Bogen anhand von Mittelpunkt, Radius und Winkel erstellen
# note: Winkel in Blöcken oder Codeblöcken werden im Bogenmaß angegeben.
byCenterPointRadiusAngle = Arc.ByCenterPointRadiusAngle(center=byCoordinates_11, radius=code_block_15.out0, startAngle=code_block_15.out1, endAngle=number_slider_11, normal=ZAxis)

# group: Bogen mithilfe von Blöcken > Ausgaben visualisieren
endPoint = Curve.EndPoint(curve=byCenterPointRadiusAngle)
byStartPointEndPoint = Line.ByStartPointEndPoint(startPoint=endPoint, endPoint=byCoordinates_11)
startPoint = Curve.StartPoint(curve=byCenterPointRadiusAngle)
byStartPointEndPoint_2 = Line.ByStartPointEndPoint(startPoint=startPoint, endPoint=byCoordinates_11)

# group: Vorgänge mithilfe von Blöcken > -
code_block_16 = CodeBlock { 5; 2; }
sub = code_block_16.out0 - code_block_16.out1
watch = Watch(sub)

# group: Vorgänge mithilfe von Codeblöcken > -
code_block_17 = CodeBlock { 5-2; }
watch_2 = Watch(code_block_17)

# group: Vorgänge mithilfe von Codeblöcken > %
code_block_18 = CodeBlock { 5%2; }
watch_3 = Watch(code_block_18)

# group: Vorgänge mithilfe von Blöcken > %
code_block_19 = CodeBlock { 5; 2; }
mod = code_block_19.out0 % code_block_19.out1
watch_4 = Watch(mod)

# group: Vorgänge mithilfe von Codeblöcken > <=
code_block_20 = CodeBlock { 5<=2; }
watch_5 = Watch(code_block_20)

# group: Vorgänge mithilfe von Codeblöcken > >
code_block_21 = CodeBlock { 5>2; }
watch_6 = Watch(code_block_21)

# group: Vorgänge mithilfe von Blöcken > <=
code_block_22 = CodeBlock { 5; 2; }
le = code_block_22.out0 <= code_block_22.out1
watch_7 = Watch(le)

# group: Vorgänge mithilfe von Blöcken > >
code_block_23 = CodeBlock { 5; 2; }
gt = code_block_23.out0 > code_block_23.out1
watch_8 = Watch(gt)

# group: Bogen mithilfe von Codeblöcken > Eingaben
# Erstellen Sie die erforderlichen Eingaben:
# 1. Mittelpunkt
# 2. Endwinkel
code_block_24 = CodeBlock { 15; 35; }
byCoordinates_12 = Point.ByCoordinates(x=code_block_24.out0, y=code_block_24.out1)
number_slider_12 = DoubleSlider(126.947, range=0..360 step 0.1)  # graph input

# group: Bogen mithilfe von Codeblöcken > Bogen anhand von Mittelpunkt, Radius und Winkel erstellen
code_block_25 = CodeBlock(center=byCoordinates_12, endAngle=number_slider_12) { Arc.ByCenterPointRadiusAngle(center,5,0,endAngle,Vector.ZAxis()); }

# group: Bogen mithilfe von Codeblöcken > Ausgaben visualisieren
startPoint_2 = Curve.StartPoint(curve=code_block_25)
byStartPointEndPoint_3 = Line.ByStartPointEndPoint(startPoint=startPoint_2, endPoint=byCoordinates_12)
endPoint_2 = Curve.EndPoint(curve=code_block_25)
byStartPointEndPoint_4 = Line.ByStartPointEndPoint(startPoint=endPoint_2, endPoint=byCoordinates_12)

# group: Runden mithilfe von Blöcken > Eingaben
code_block_26 = CodeBlock { 3.14159; }
code_block_27 = CodeBlock { 3; }

# group: Runden mithilfe von Blöcken > Abrunden
floor = Math.Floor(number=code_block_26)
watch_9 = Watch(floor)

# group: Runden mithilfe von Blöcken > Aufrunden
ceiling = Math.Ceiling(number=code_block_26)
watch_10 = Watch(ceiling)

# group: Runden mithilfe von Blöcken > Auf- oder abrunden
# Welcher Wert am Nächsten liegt
round = Math.Round(number=code_block_26)
watch_11 = Watch(round)

# group: Runden mithilfe von Blöcken > Auf angegebene Anzahl an Stellen runden
round_2 = Math.Round(number=code_block_26, digits=code_block_27)
watch_12 = Watch(round_2)

# group: Runden mithilfe von Codeblöcken > Eingaben
code_block_28 = CodeBlock { 3.14159; }

# group: Runden mithilfe von Codeblöcken > Abrunden
code_block_29 = CodeBlock(num=code_block_28) { Math.Floor(num); }
watch_13 = Watch(code_block_29)

# group: Runden mithilfe von Codeblöcken > Aufrunden
code_block_30 = CodeBlock(num=code_block_28) { Math.Ceiling(num); }
watch_14 = Watch(code_block_30)

# group: Runden mithilfe von Codeblöcken > Auf- oder abrunden
# Welcher Wert am Nächsten liegt
code_block_31 = CodeBlock(num=code_block_28) { Math.Round(num); }
watch_15 = Watch(code_block_31)

# group: Runden mithilfe von Codeblöcken > Auf angegebene Anzahl an Stellen runden
# Beschreibung <Hier doppelklicken, um die Gruppenbeschreibung zu bearbeiten>
code_block_32 = CodeBlock(num=code_block_28) { Math.Round(num,3); }
watch_16 = Watch(code_block_32)

# group: Vorgänge mithilfe von Codeblöcken > ==(equals)
code_block_33 = CodeBlock { true == false; }
watch_17 = Watch(code_block_33)

# group: Vorgänge mithilfe von Codeblöcken > Not
code_block_34 = CodeBlock { !true; }
watch_18 = Watch(code_block_34)

# group: Vorgänge mithilfe von Codeblöcken > && (and)
code_block_35 = CodeBlock { true && false; }
watch_19 = Watch(code_block_35)

# group: Vorgänge mithilfe von Codeblöcken > || (or)
code_block_36 = CodeBlock { true || false; }
watch_20 = Watch(code_block_36)

# group: Vorgänge mithilfe von Blöcken > ==(equals)
boolean = BoolSelector(true)  # graph input
boolean_2 = BoolSelector(false)  # graph input
eq = boolean == boolean_2
watch_21 = Watch(eq)

# group: Vorgänge mithilfe von Blöcken > || (or)
boolean_3 = BoolSelector(true)  # graph input
boolean_4 = BoolSelector(false)  # graph input
or_ = boolean_3 || boolean_4
watch_22 = Watch(or_)

# group: Vorgänge mithilfe von Blöcken > && (and)
boolean_5 = BoolSelector(true)  # graph input
boolean_6 = BoolSelector(false)  # graph input
and_ = boolean_5 && boolean_6
watch_23 = Watch(and_)

# group: Vorgänge mithilfe von Blöcken > Not
boolean_7 = BoolSelector(true)  # graph input
not_ = Not(x=boolean_7)
watch_24 = Watch(not_)
