# Dynamo graph Core_PassingFunctions.dyn (Dynamo 3.1.0.3411)
# author: Dynamo Team
# Zeigt, wie eine Funktion in Dynamo übergeben wird

# group: Info
# note: Übergeben von Funktionen
# Dynamo ist eine funktionale Sprache, d. h., Aktionen können auf dieselbe Weise behandelt werden wie Objekte. Die meisten Blöcke in Dynamo können in Funktionen umgewandelt und in sehr präziser Weise für einen Satz von Daten verwendet werden.
# Das Erstellen und Übergeben einer Funktion ist im Alltagsleben dem Befehl "20 Minuten laufen!" vergleichbar, wobei nachträglich festgelegt wird, an wen der Befehl gerichtet ist.
# In diesem Beispiel wird ein Raster von Kreisen in einer komplexen Struktur dargestellt. Der Befehl zur Auswahl einer Gruppe von Kreisen wird direkt verwendet, anschließend wird der Befehl stattdessen als Funktion an tiefere Datenebenen übergeben, was ein anderes Ergebnis zur Folge hat.

# group: Anfängliche Eingaben
# 5x8-Punktmatrix erstellen
code_block = CodeBlock { 0..#8..4; }
code_block_2 = CodeBlock { 0..#5..4; }
byCoordinates = Point.ByCoordinates(x=code_block, y=code_block_2, lacing=CrossProduct)

# group: Kreismatrix zeichnen
# note: Die Liste der Punkte ist in einer hierarchischen Struktur geordnet, d. h., sie ist eine Liste von Listen. Das Raster wurde mit 8 Punkten in X- und 5 Punkten in Y-Richtung erstellt. Diese Liste enthält 8 Listen mit je 5 Einträgen, d. h. Listen mit Spalten für die Punkte.
watch = Watch(byCoordinates)
code_block_3 = CodeBlock { 1.5; }
# note: Zeichnen Sie einen Kreis um jeden Punkt.
byCenterPointRadius = Circle.ByCenterPointRadius(centerPoint=watch, radius=code_block_3)

# group: Zweite und dritte LISTE auswählen
# Übergeben der Funktion
code_block_4 = CodeBlock { 1..2; }
# note: Aus der verschachtelten Liste der Kreise werden die Einträge {1,2} gewählt. Dynamo-Blöcke funktionieren immer "von außen nach innen", d. h. von der höchsten zur tiefsten Listenebene.
# Wenn Sie die Einträge 1 und 2 in der Liste wählen, werden die Listen #1 und #2 aus der ursprünglichen verschachtelten Listenstruktur zurückgegeben.
getItemAtIndex = List.GetItemAtIndex(list=byCenterPointRadius, index=code_block_4)

# group: NACH OBEN extrudieren
# Resultierende Zylinder
# note: Die ausgewählten Daten sind weiterhin in derselben Struktur vorhanden wie vor der Auswahl durch die Zuordnung.
watch_2 = Watch(getItemAtIndex)
code_block_5 = CodeBlock { 3; }
# note: Diese Liste der Kreise wird nach oben extrudiert.
extrude = Curve.Extrude(curve=watch_2, distance=code_block_5)

# group: Zweites und drittes ELEMENT aus JEDER LISTE auswählen
# Übergeben der Funktion
code_block_6 = CodeBlock { 1..2; }
# note: Die Funktion List@Level verwendet nicht die ersten beiden Listen aus der Ausgabe des Blocks, sondern ermöglicht die Verwendung der Elemente an Position #1 und #2 aus jeder der beiden Listen durch Auswahl von L2 am Eingabeanschluss von List.GetItemAtIndex.
# Diese Funktion entspricht der Funktion List.Map, einer Methode zum Zugriff auf die inneren Ebenen der eingegebenen Listen in den vorherigen Versionen von Dynamo.
getItemAtIndex_2 = List.GetItemAtIndex(list=byCenterPointRadius@L2, index=code_block_6)

# group: NACH UNTEN extrudieren
# Resultierende Zylinder
watch_3 = Watch(getItemAtIndex_2)
code_block_7 = CodeBlock { -3; }
# note: Diese Liste der Kreise wird nach unten extrudiert.
extrude_2 = Curve.Extrude(curve=watch_3, distance=code_block_7)
