# Dynamo graph Core_Python.dyn (Dynamo 4.1.0.2940)
# author: Dynamo Team
# Verwendung des Python-Blocks in Dynamo

# group: Info
# note: PYTHON
# Dynamo unterstützt CPython über einen von zwei Python-Blocktypen. (Mithilfe eines zweiten, hier nicht gezeigten Typs von Python-Blöcken können Skripts aus externen Dateien gelesen und ausgeführt werden.)
# Doppelklicken Sie auf den Python-Block, um das darin enthaltene Skript anzuzeigen.
# Die Eingabe ist im IN-Array enthalten. Die Ausgabe muss der OUT-Variablen zugewiesen werden. Die Ausgabe kann ein einzelner Wert oder ihrerseits ein Array sein.

# group: Verwendung des Python-Blocks zum Anwenden der Zeichenbearbeitung auf die Liste
# note: In diesem Beispiel wird eine Addition oder Subtraktion für alle Elemente in einer Liste ausgeführt. Die Eingaben sind eine Zahl, deren Vorzeichen bestimmt, ob eine Addition oder eine Subtraktion ausgeführt wird, sowie eine Liste von Zahlen.

# group: Positive Zahl, 0 oder negative Zahl wählen
# Beschreibung <Hier doppelklicken, um die Gruppenbeschreibung zu bearbeiten>
# note: Wählen Sie das Vorzeichen für die Operation
#     Zahl < 0      Schritt subtrahieren
#     Zahl = 0      0
#     Zahl > 0      Schritt addieren
integer_slider = IntegerSlider(1, range=-1..2 step 1)

# group: Eingabeliste erstellen
# note: Beliebige Liste erstellen
code_block = CodeBlock { 0..10; }
watch = Watch(code_block)

# group: Python
# Wendet Zeichenbearbeitung an
# note: Die Ausgabe von OUT ist ein Array, wobei das erste Element ein einzelner Wert und das zweite eine Liste von Werten ist. Diese Datenstruktur wurde in der Python-Definition selbst festgelegt. Durch Festlegen eines Arrays können Sie beliebig viele Ausgabewerte an das Dynamo-Diagramm senden.
python_script = Python(Sign=integer_slider, List=watch)  # PythonNet3
# ---------- python_script.python (31 lines) ----------
# Python script to find add or subtract a series of numbers. 

# Boiler-plate import statments included out-of-the-box
import clr
clr.AddReference('ProtoGeometry')
from Autodesk.DesignScript.Geometry import *

# The inputs to this node will be stored as a list in the IN variable.
sign = IN[0]  # -1 for subtract all, 0 for do nothing, 1 for add all
nums = IN[1]  # List of numbers to subtract or add

partials = [] # Empty array to contain partial sums or differences
result = 0    # Initialize the sum or difference to 0

# Loop through each item and add it or subtract it from the result.
for index in range(len(nums)):
	if sign > 0:
		result = result + nums[index]
		partials.append(result)
	elif sign == 0:
		partials.append(result)
		continue
	else:
		result = result - nums[index]
		partials.append(result)

# Assign the output to the OUT variable
#OUT = results  # Use this to output only the result.
OUT = []
OUT.append(result)
OUT.append(partials)
# ----------------------------------------

# group: Resultierende Liste
code_block_2 = CodeBlock { 1; }
getItemAtIndex = List.GetItemAtIndex(list=python_script, index=code_block_2)
# note: Die Folge der Teilergebnisse
watch_2 = Watch(getItemAtIndex)

# group: Resultierende Summe
code_block_3 = CodeBlock { 0; }
getItemAtIndex_2 = List.GetItemAtIndex(list=python_script, index=code_block_3)
# note: Gesamtergebnis
watch_3 = Watch(getItemAtIndex_2)

# group: Python-Geometrieerstellung
# note: Dieses Python-Beispiel hat keine Eingaben. Es demonstriert die Erstellung von Geometrie mithilfe der Protogeometrie-Bibliothek von Dynamo. Da mit dem Python-Block sichtbare Geometrie erstellt wird, wird die Geometrie bei Auswahl des Blocks (wie bei jedem anderen Block) hervorgehoben.
python_script_2 = Python()  # PythonNet3
# ---------- python_script_2.python (24 lines) ----------
import clr
clr.AddReference('ProtoGeometry')
from Autodesk.DesignScript.Geometry import *
#The inputs to this node will be stored as a list in the IN variable.
dataEnteringNode = IN

p1 = Point.ByCoordinates(0, 0, 0);
p2 = Point.ByCoordinates(-10, -10, -10);

l = Line.ByStartPointEndPoint(p1, p2);

pts = [
	Point.ByCoordinates(0, 0, 0),
	Point.ByCoordinates(10, 10, 0),
	Point.ByCoordinates(20, 0, 0),
	Point.ByCoordinates(30, 10, 0),
	Point.ByCoordinates(40, 0, 0) ]
	
spline = NurbsCurve.ByPoints(pts)

surf = spline.Extrude(Vector.ByCoordinates(0, 0, 1), 10)

#Assign your output to the OUT variable
OUT = [l, spline, surf]
# ----------------------------------------

# group: Resultierende Ausgabe prüfen
# note: Tipp: Verwenden Sie einen Codeblock
# für den Zugriff auf bestimmte Elemente in einer Liste.
code_block_4 = CodeBlock(output=python_script_2) { output[0]; output[1]; output[2]; }
watch_4 = Watch(code_block_4.out2)
watch_5 = Watch(code_block_4.out0)
watch_6 = Watch(code_block_4.out1)
