# Dynamo graph Core_RangeSyntax.dyn (Dynamo 3.0.0.6964)
# author: Dynamo Team
# Dieses Diagramm bietet mehrere Möglichkeiten zum Erstellen einer Reihe von gleichmäßig angeordneten Zahlen oder Zeichen.

# group: Info
# note: Bereichssyntax
# Listen können auf verschiedene Weise als Folgen von Zahlen oder Zeichen erstellt werden.
# Folgen sind nützlich, wenn Sie Arrays von Elementen erstellen, Iterationen durchführen und verschiedene Funktionen und Gleichungen vorbereiten.

# group: Verwenden von Code Block
# note: start..end..step
# Von 0 bis 10 in Schritten von 2
# Diese Methode entspricht der Verwendung des Range-Blocks
code_block = CodeBlock { 0..10..2; }
watch = Watch(code_block)
# note: start..end
# Wenn der Wert für step nicht angegeben ist, wird von 1 ausgegangen.
# Diese Methode ist identisch mit der Verwendung des Range-Blocks
# note: Verwenden Sie die Bereichssyntax in einem Codeblock-Block. Es sind mehrere vorhanden, und Ihnen stehen mehrere Methoden zur Erstellung einer Reihe von Zahlen (oder Zeichen) zur Verfügung:
#         start..end..step
#         start..end..#amount
#         start..#amount..interval
# start = Anfangszahl/Anfangszeichen der Reihe
# end = Endzahl/Endzeichen der Reihe
# step = Differenz zwischen zwei aufeinander folgenden Zahlen/Zeichen
# amount = Anzahl der Zahlen/Zeichen in der Reihe
code_block_2 = CodeBlock { 0..10; }
watch_2 = Watch(code_block_2)
# note: start..end..#amount
# Von 0 bis 10 in 3 Schritten
code_block_3 = CodeBlock { 0..10..#3; }
watch_3 = Watch(code_block_3)
# note: start..#amount..interval
# 10 Schritte beginnend mit 0, jeder Schritt entspricht 3
# Diese Methode entspricht der Verwendung des Sequence-Blocks
code_block_4 = CodeBlock { 0..#10..3; }
watch_4 = Watch(code_block_4)

# group: Code Block mit dynamischer Eingabe verwenden
integer_slider = IntegerSlider(7, range=0..10 step 1)
# note: Ersetzen Sie einen Wert durch eine Variable, und verwenden Sie einen Schieberegler, um die Länge der Liste dynamisch zu steuern.
code_block_5 = CodeBlock(howMany=integer_slider) { 0..#howMany..3; }
watch_5 = Watch(code_block_5)

# group: Verwendung von Sequence
number = DoubleInput(0)
number_slider = DoubleSlider(8, range=0..10 step 0.1)
number_2 = DoubleInput(2)
# note: Verwenden Sie einen Sequence-Block, wenn die Anzahl der Elemente in der Liste und die Länge der einzelnen Schritte bekannt sind. Das letzte Ergebnis in der Liste ist nicht vordefiniert, sondern wird anhand anderer Eingaben berechnet.
# Beispiel: Entwurf eines Parkplatzes mit Parkbuchten für 8 Autos und einer bekannten Breite für jede Parkbucht. Die Gesamtbreite aller Parkbuchten ist abhängig von der jeweiligen Breite und Anzahl der Buchten.
sequence = Sequence(start=number, amount=number_slider, step=number_2, lacing=Longest)
watch_6 = Watch(sequence)

# group: Verwendung von Range
number_3 = DoubleInput(0)
number_4 = DoubleInput(10)
number_slider_2 = DoubleSlider(1.75, range=0..10 step 0.1)
# note: Verwenden Sie einen Range-Block, wenn Start und Ende der Folge bekannt sind. Die Anzahl der Elemente in der resultierenden Liste ist nicht vordefiniert, sondern wird basierend auf anderen Eingaben berechnet.
# Beachten Sie, dass das letzte Element in der Liste möglicherweise nicht mit der 'end'-Eingabe übereinstimmt, wenn der Wert für step über 'end' hinausgeht, wenn dieser durch einen zusätzlichen Schritt überschritten wird.
# Wenn Sie den Wert step zwischen den angegebenen Werten für 'start' und 'end' erhöhen, kann dies zu weniger Elementen führen, und umgekehrt. Wenn Sie den Wert für step verringern, wird die Liste verlängert.
range = Range(start=number_3, end=number_4, step=number_slider_2, lacing=Longest)
watch_7 = Watch(range)

# group: Verwendung von Range - mit Zeichenfolgen
string = StringInput("A")
string_2 = StringInput("P")
code_block_6 = CodeBlock { 1; }
# note: Range kann auch verwendet werden, um Zeichenfolgen zu generieren.
range_2 = Range(start=string, end=string_2, step=code_block_6, lacing=Longest)
watch_8 = Watch(range_2)

# group: Verwenden von Sequence - mit Zeichenfolgen
string_3 = StringInput("A")
code_block_7 = CodeBlock { 20; }
# note: Sequence-Block verwenden, um eine Reihe von Buchstaben in alphabetischer Reihenfolge zu erstellen
sequence_2 = Sequence(start=string_3, amount=code_block_7)
watch_9 = Watch(sequence_2)

# note: Folge von Werten verwenden, um eine Reihe von Punkten zu erstellen
byCoordinates = Point.ByCoordinates(x=code_block_5)
