# Dynamo graph Core_Strings.dyn (Dynamo 3.4.1.7055)
# author: Dynamo Team
# Dieses Diagramm zeigt Aktionen, die für Zeichenfolgen durchgeführt werden können.

# group: Info
# note: ZEICHENFOLGEN
# Diese Beispiele veranschaulichen einige Aktionen, die mit Zeichenfolgen ausgeführt werden können. Weitere Blöcke für Zeichenfolgenvorgänge finden Sie in der Blockbibliothek unter der Kategorie String

byCoordinates = Point.ByCoordinates()
code_block = CodeBlock { 5; }
# note: Objekt erstellen - Kreis
byCenterPointRadius = Circle.ByCenterPointRadius(centerPoint=byCoordinates, radius=code_block)

# group: Objekt in Zeichenfolge umwandeln
# note: Konvertiert ein Objekt in eine Zeichenfolgenbeschreibung seiner selbst.
string_from_object = FromObject(obj=byCenterPointRadius)

watch = Watch(string_from_object)

# group: Zeichenfolge mit Trennzeichen unterteilen
code_block_2 = CodeBlock { "("; ")"; " "; "="; ","; }
# note: Unterteilen Sie eine Zeichenfolge durch Angabe eines oder mehrerer Trennzeichen in mehrere Teile. Jedes Trennzeichen kann ein oder mehrere Zeichen umfassen.
split = String.Split(string=watch, separator0=code_block_2.out0, separator1=code_block_2.out1, separator2=code_block_2.out2, separator3=code_block_2.out3, separator4=code_block_2.out4)

watch_2 = Watch(split)

# group: Prüfen, ob eine Zeichenfolge eine Teilzeichenfolge enthält
code_block_3 = CodeBlock { "."; }
# note: Stellt fest, ob eine Zeichenfolge eine andere Zeichenfolge enthält.
contains = String.Contains(string=watch_2, searchFor=code_block_3)

watch_3 = Watch(contains)

# group: Zeichenfolge erstellen
# note: Verwenden Sie einen Codeblock zum Erstellen einer Zeichenfolge - ""-Markierungen begrenzen den Zeichenfolgenwert.
code_block_4 = CodeBlock { "Few things are harder to put up with than a good example."; }

# group: In GROSSBUCHSTABEN ändern
string = StringInput(" - Mark Twain")
# note: Ändert die Groß- und Kleinschreibung einer Zeichenfolge.
toUpper = String.ToUpper(string=string)
watch_4 = Watch(toUpper)

# group: Verketten
# note: Das Anhängen einer Zeichenkette an eine andere, um eine längere Zeichenkette zu bilden, wird als "Verkettung" bezeichnet.
concat = String.Concat(string0=code_block_4, string1=watch_4)

watch_5 = Watch(concat)

# group: Zeichen in einer Zeichenfolge ersetzen
code_block_5 = CodeBlock { "put"; }
code_block_6 = CodeBlock { "come"; }
# note: Ersetzen Sie alle Vorkommen einer Teilzeichenfolge durch eine Ersatzzeichenfolge.
replace = String.Replace(string=watch_5, searchFor=code_block_5, replaceWith=code_block_6)

watch_6 = Watch(replace)

# group: Teilzeichenfolge in einer Zeichenfolge suchen
code_block_7 = CodeBlock { " to"; }
# note: Ermitteln Sie, wo in einer Zeichenfolge eine bestimmte Teilzeichenfolge auftritt. Das Ergebnis ist der Index, an dem die Teilzeichenfolge beginnt.
indexOf = String.IndexOf(string=watch_6, searchFor=code_block_7)
watch_7 = Watch(indexOf)

# group: Länge der Zeichenfolge
# note: Ermittelt die Gesamtanzahl der Zeichen in einer Zeichenfolge.
length = String.Length(string=watch_6)
watch_8 = Watch(length)

# note: Ersten Teil der Zeichenfolge von der Gesamtlänge der Zeichenfolge subtrahieren
sub = watch_8 - watch_7

# group: Zeichen entfernen
# note: Entfernt eine bestimmte Anzahl von Zeichen aus einer Zeichenfolge.
remove = String.Remove(string=watch_6, startIndex=watch_7, count=sub)

# group: Vorkommen zählen
watch_9 = Watch(remove)
code_block_8 = CodeBlock { "ar"; }
# note: Zählt die Vorkommen einer Teilzeichenfolge innerhalb einer Zeichenfolge.
countOccurrences = String.CountOccurrences(string=watch_9, searchFor=code_block_8)
watch_10 = Watch(countOccurrences)

# group: Zeichenfolge erstellen
# note: Wenn die Zeichenfolge ein "-Zeichen enthält, verwenden Sie ein Escape-Zeichen \ vor ", um es als Teil und nicht als Ende der Zeichenfolge zu behandeln.
code_block_9 = CodeBlock { "There is no \"I\" in Team"; }
watch_11 = Watch(code_block_9)

zahlenbereich = CodeBlock { 2..101; }

# group: Zeichenfolgen mit Hinzufügen verketten
code_block_10 = CodeBlock { " Dalmatians"; }
# note: Mit dem Vorgang Hinzufügen werden Zahlen automatisch in Zeichenfolgen konvertiert, und es wird eine Verkettung durchgeführt
add = zahlenbereich + code_block_10
watch_12 = Watch(add)

# group: Objekt in Zeichenfolge umwandeln
# note: In einigen Fällen ist es erforderlich, ein Objekt zunächst in eine Zeichenfolge zu konvertieren
string_from_object_2 = FromObject(object=zahlenbereich)
watch_13 = Watch(string_from_object_2)
type = Object.Type(object=string_from_object_2)
watch_14 = Watch(type)

# group: Zeichenfolge in Zahl umwandeln
code_block_11 = CodeBlock { "101 Dalmatians"; }
code_block_12 = CodeBlock { " "; }
# note: Zeichenfolge mit Leerzeichen als Trennzeichen in Wörter unterteilen
split_2 = String.Split(string=code_block_11, separator0=code_block_12)
# note: Erstes Element aus einer Liste abrufen
firstItem = List.FirstItem(list=split_2)
# note: Zeichenfolge in eine Zahl umwandeln
toNumber = String.ToNumber(string=firstItem)
watch_15 = Watch(toNumber)
type_2 = Object.Type(object=toNumber)
watch_16 = Watch(type_2)

# group: Zeichenfolgen in Zahlen umwandeln
# note: Liste mit Booleschen Werten als Maske für einen Filter verwenden, um alle Zahlen in einer Liste abzurufen
filterByBoolMask = List.FilterByBoolMask(list=watch_2, mask=contains)
# note: Zeichenfolgen in Zahlen umwandeln
toNumber_2 = String.ToNumber(string=filterByBoolMask.in)

watch_17 = Watch(filterByBoolMask.in)
