# Dynamo graph Geometry_Curves.dyn (Dynamo 3.1.0.3411)
# author: Dynamo Team
# Ein Beispieldiagramm, das zeigt, wie die grundlegenden Kurven-Grundkörper erstellt werden - Linie, PolyCurve, offene und geschlossene NURBS-Kurve

# group: Info
# note: Dieses Diagramm veranschaulicht, wie die grundlegenden Kurven-Grundkörper erstellt werden - Linie, PolyCurve, offene und geschlossene NURBS-Kurve

# group: Anfängliche Eingaben
number = DoubleInput(5)
number_2 = DoubleInput(10)
number_3 = DoubleInput(15)

# group: Anfängliche 4 Punkte
byCoordinates = Point.ByCoordinates()
byCoordinates_2 = Point.ByCoordinates(y=number)
byCoordinates_3 = Point.ByCoordinates(x=number_2, y=number_2)
byCoordinates_4 = Point.ByCoordinates(x=number_3)

# group: Liste mit 4 Punkten
create = List.Create(item0=byCoordinates, item1=byCoordinates_2, item2=byCoordinates_3, item3=byCoordinates_4)

# group: NURBS-Kurve
# note: Erstellt eine NURBS-Kurve durch 4 Punkte
byPoints = NurbsCurve.ByPoints(points=create)

# group: Linie
# note: Einzelne gerade Linie durch 2 Punkte
byStartPointEndPoint = Line.ByStartPointEndPoint(startPoint=byCoordinates, endPoint=byCoordinates_2)

length = Curve.Length(curve=byStartPointEndPoint)

# group: NURBS-Kurve - geschlossen
boolean = BoolSelector(true)
# note: Geschlossene NURBS-Kurve innerhalb der Begrenzungspunkte erstellen
byControlPoints = NurbsCurve.ByControlPoints(points=create, closeCurve=boolean)

# group: PolyCurve
# Beschreibung <Hier doppelklicken, um die Gruppenbeschreibung zu bearbeiten>
# note: Gerade PolyCurve durch eine Reihe von Punkten erstellen
# note: Neue Anmerkung
byPoints_2 = PolyCurve.ByPoints(points=create)

# group: Aktionen und Abfragen
code_block = CodeBlock { 0..1..#20; }
# note: Kurven, Polykurven (Sammlungen von Kurven), Nurbs und Linien sind von Kurven abgeleitet. Daher können sämtliche für Kurven verfügbaren Aktionen und Abfragen auch für alle diese Elemente ausgeführt werden.
pointAtParameter = Curve.PointAtParameter(curve=byPoints_2, param=code_block)
