# Dynamo graph Geometry_Points.dyn (Dynamo 3.1.0.3411)
# author: Dynamo Team
# Punkte-Array erstellen

# group: Anfängliche Eingaben
number_slider = DoubleSlider(6.4, range=0..10 step 0.1)

# group: Einzelner Punkt
# note: Grundlegende geometrische Elemente verfügen über Vorgabewerte für numerische Eingaben. Überprüfen Sie die Vorgabewerte, indem Sie den Mauszeiger über den Eingabeanschluss des Blocks bewegen
byCoordinates = Point.ByCoordinates(z=number_slider)

# group: Ergebnisvorschau anzeigen
# note: Nachdem Sie auf Ausführen geklickt oder Automatisch ausführen aktiviert haben, können Sie das geometrische Objekt in der Hintergrundvorschau, in Watch 3D oder als Daten in einem Watch-Block anzeigen. Elemente werden im Hintergrund hervorgehoben, wenn der Block ausgewählt ist
watch_3d = Watch3D(byCoordinates)

# group: Anfängliche Eingaben
number = DoubleInput(0)
number_2 = DoubleInput(10)
number_3 = DoubleInput(1)

# group: Zahlenbereich
# note: Arrays von Geometrie können mithilfe von Sequenzen, Bereichen und Listen erstellt werden.
range = Range(start=number, end=number_2, step=number_3, lacing=Longest)

# group: Punktmatrix
# note: Erstellen Sie 1-, 2- und 3-dimensionale Arrays, indem Sie Bereiche an die X-, Y- und Z-Anschlüsse der Punkte übergeben und dann die Vergitterungseigenschaften im Kontextmenü für den Block ändern. Beachten Sie das Ergebnis, wenn Sie die Option Kartesisches Produkt - Vergitterung auswählen
byCoordinates_2 = Point.ByCoordinates(x=range, y=range, lacing=CrossProduct)

watch = Watch(byCoordinates)

# group: Punkt in Vektor umwandeln
# Beschreibung <Hier doppelklicken, um die Gruppenbeschreibung zu bearbeiten>
# note: Einige Elemente können problemlos in andere konvertiert werden
asVector = Point.AsVector(point=watch)

# group: Matrix anhand des Punkts als Vektor verschieben
# note: Zum Erstellen abgeleiteter Elemente können Werkzeuge in der Unterkategorie Aktionen des Objekts verwendet werden.
add = Point.Add(point=byCoordinates_2, vectorToAdd=asVector)

# group: Vorschau der 'Z'-Koordinate des Punkts anzeigen
# note: Informationen können mithilfe von Blöcken in der Unterkategorie Abfrage der einzelnen Blockgruppen (neben dem Fragezeichensymbol) aus der Geometrie extrahiert werden
Z = Point.Z(point=byCoordinates)
