# Dynamo graph Geometry_Solids.dyn (Dynamo 3.1.0.3411)
# author: Dynamo Team
# Dynamo-Beispieldiagramm, das die Volumenkörpererstellung mit Erhebungs- und Volumenkörperbearbeitung (Addition und Subtraktion) veranschaulicht

# group: Anfängliche Punkte für die erste Kurvengruppe
byCoordinates = Point.ByCoordinates()
number = DoubleInput(10)
byCoordinates_2 = Point.ByCoordinates(x=number)
byCoordinates_3 = Point.ByCoordinates(y=number)

# group: Zusätzlicher Punkt für die zweite Kurvengruppe
number_2 = DoubleInput(5)
byCoordinates_4 = Point.ByCoordinates(z=number_2)

# group: Anfängliche Kurven für die untere Basis erstellen
byStartPointEndPoint = Line.ByStartPointEndPoint(startPoint=byCoordinates, endPoint=byCoordinates_2)
byThreePoints = Arc.ByThreePoints(firstPoint=byCoordinates, secondPoint=byCoordinates_4, thirdPoint=byCoordinates_2)

# group: Untere Basis erstellen
create = List.Create(item0=byStartPointEndPoint, item1=byThreePoints)
byJoinedCurves = PolyCurve.ByJoinedCurves(curves=create)

# group: Zusätzlicher Punkt für die dritte Kurvengruppe
number_3 = DoubleInput(15)
byCoordinates_5 = Point.ByCoordinates(x=number_3, y=number_3)

# group: Zusätzlicher Punkt für die vierte Kurvengruppe
number_4 = DoubleInput(5)
number_5 = DoubleInput(10)
byCoordinates_6 = Point.ByCoordinates(x=number_4, y=number_5, z=number_5)

# group: Anfängliche Kurven für die obere Basis erstellen
byStartPointEndPoint_2 = Line.ByStartPointEndPoint(startPoint=byCoordinates_3, endPoint=byCoordinates_5)
byThreePoints_2 = Arc.ByThreePoints(firstPoint=byCoordinates_3, secondPoint=byCoordinates_6, thirdPoint=byCoordinates_5)

# group: Obere Basis erstellen
create_2 = List.Create(item0=byStartPointEndPoint_2, item1=byThreePoints_2)
byJoinedCurves_2 = PolyCurve.ByJoinedCurves(curves=create_2)

# group: Basiskurven in einer Liste kombinieren
create_3 = List.Create(item0=byJoinedCurves, item1=byJoinedCurves_2)

# group: Erhebung
# note: Für die meisten Volumenkörper stehen mehrere Erstellungsmethoden zur Verfügung. In diesen Beispielen werden geschlossene Profile als Basis verwendet, es ist jedoch auch möglich, mehrere Polysurfaces zusammenzufügen. Eine große Zahl von Grundkörpern steht zur Verfügung (Oberflächen, Quader, Kegel usw.).
byLoft = Solid.ByLoft(crossSections=create_3)

# group: Volumen
# note: Sie können das Volumen der Erhebung prüfen, um zu zeigen, dass es sich um eine geschlossene Volumengeometrie handelt
volume = Solid.Volume(solid=byLoft)

# group: Zusätzlicher Punkt für die zusätzliche Erhebungsgeometrie
number_6 = DoubleInput(-2)
number_7 = DoubleInput(5)
byCoordinates_7 = Point.ByCoordinates(x=number_6, y=number_7)

# group: Punkte in einer Liste kombinieren
create_4 = List.Create(item0=byCoordinates, item1=byCoordinates_7, item2=byCoordinates_3)

# group: Zusätzliche Basiskurve erstellen
# Beschreibung <Hier doppelklicken, um die Gruppenbeschreibung zu bearbeiten>
# note: Dieses Mal wird eine NURBS-Kurve anhand der Punktgruppe erstellt
byPoints = NurbsCurve.ByPoints(points=create_4)

# group: Erhebung +
# note: Tipp: Deaktivieren Sie "Vorschau" im Kontextmenü von Blöcken, um Elemente von der Anzeige auszuschließen.
byLoft_2 = Solid.ByLoft(crossSections=create_3, guideCurves=byPoints)

# group: Geometrie +
code_block = CodeBlock { Vector.ByCoordinates(-20,0,0); }
# note: Geometrie zur Visualisierung der Ausgabe verschieben
translate = Geometry.Translate(geometry=byLoft_2, direction=code_block)

# group: 'Zutaten' zum Stutzen der Volumengeometrie vorbereiten
# note: Dicke
code_block_2 = CodeBlock { 0; }
# note: Tipp: Deaktivieren Sie "Vorschau" im Kontextmenü von Blöcken, um Elemente von der Anzeige auszuschließen.
thinShell = Solid.ThinShell(solid=byLoft, internalFaceThickness=code_block_2)
code_block_3 = CodeBlock { Vector.ByCoordinates(20,0,0); }
# note: Geometrie um 20 Einheiten in X-Richtung verschieben
translate_2 = Geometry.Translate(geometry=thinShell, direction=code_block_3)
code_block_4 = CodeBlock { Point.ByCoordinates(0,0,5); }
ZAxis = Vector.ZAxis()
# note: Ebene erstellen, die durch den Volumenkörper verläuft, mit dem geschnitten werden soll
byOriginNormal = Plane.ByOriginNormal(origin=code_block_4, normal=ZAxis)
# note: Dieser Punkt bestimmt, welcher Teil des Volumenkörpers gestutzt wird
code_block_5 = CodeBlock { Point.ByCoordinates(10,10,10); }

# group: Erhebung -
# note: Geometrische boolesche Operationen (Schnitt, Differenz, Vereinigung usw.) stehen in der Kategorie Geometrie zur Verfügung.
trim = Geometry.Trim(geometry=translate_2, other=byOriginNormal, pick=code_block_5)
