# Dynamo graph Geometry_Surfaces.dyn (Dynamo 3.1.0.3411)
# Dynamo-Diagramm, das die wichtigsten Möglichkeiten zum Erstellen von Flächen zeigt - Extrusion, Erhebung und Sweep.

# group: Info
# note: Dynamo-Diagramm, das die wichtigsten Möglichkeiten zum Erstellen von Flächen zeigt - Extrusion, Erhebung und Sweep

# group: Eingabe
number = DoubleInput(10)
number_2 = DoubleInput(-10)
byCoordinates = Point.ByCoordinates(x=number, y=number_2)
byCoordinates_2 = Point.ByCoordinates(y=number_2)

# group: Linie
byStartPointEndPoint = Line.ByStartPointEndPoint(startPoint=byCoordinates, endPoint=byCoordinates_2)

# group: Eingabe
byCoordinates_3 = Point.ByCoordinates()

# group: Eingabe
number_3 = DoubleInput(5)
byCoordinates_4 = Point.ByCoordinates(z=number_3)

# group: Eingabe
number_4 = DoubleInput(10)
byCoordinates_5 = Point.ByCoordinates(x=number_4)
byCoordinates_6 = Point.ByCoordinates(y=number_4)

# group: Bogen
byThreePoints = Arc.ByThreePoints(firstPoint=byCoordinates_3, secondPoint=byCoordinates_4, thirdPoint=byCoordinates_5)

# group: Erhebung
create = List.Create(item0=byStartPointEndPoint, item1=byThreePoints)
# note: Mit den 2 Kurvensätzen können wir eine Erhebungsgeometrie zwischen ihnen erstellen
byLoft = Surface.ByLoft(crossSections=create)

# group: Erhebungsbereich auswerten
area = Surface.Area(surface=byLoft)
watch = Watch(area)

# group: Eingabe
number_5 = DoubleInput(5)
number_6 = DoubleInput(10)
byCoordinates_7 = Point.ByCoordinates(x=number_5, y=number_6, z=number_6)

# group: Eingabe
number_7 = DoubleInput(15)
byCoordinates_8 = Point.ByCoordinates(x=number_7, y=number_7)

# group: Bogen
byThreePoints_2 = Arc.ByThreePoints(firstPoint=byCoordinates_6, secondPoint=byCoordinates_7, thirdPoint=byCoordinates_8)

# group: Eingabe
number_8 = DoubleInput(-5)
number_9 = DoubleInput(5)
byCoordinates_9 = Point.ByCoordinates(x=number_8, y=number_9)

# group: Bogen
byThreePoints_3 = Arc.ByThreePoints(firstPoint=byCoordinates_3, secondPoint=byCoordinates_9, thirdPoint=byCoordinates_6)

# group: Sweep
# note: Für die meisten Oberflächen stehen mehrere Erstellungsmethoden zur Verfügung. Oberflächen, Polysurfaces (Sammlungen von Oberflächen) und Nurbs-Oberflächen können aus Punkten und Kurven erstellt oder aus anderen Oberflächen und Körpern abgeleitet werden.
bySweep2Rails = Surface.BySweep2Rails(path=byThreePoints_2, guideRail=byThreePoints, profile=byThreePoints_3)

# group: Erhebung und Sweep kombinieren
create_2 = List.Create(item0=byLoft, item1=bySweep2Rails)
# note: Zu Polysurfaces verbundene Oberflächen können als einzelnes Objekt ausgewertet werden.
byJoinedSurfaces = PolySurface.ByJoinedSurfaces(surfaces=create_2)

# group: Kombinierten Erhebungs- und Sweep-Bereich auswerten
area_2 = Surface.Area(surface=byJoinedSurfaces)
watch_2 = Watch(area_2)

# group: Sweep-Bereich auswerten
area_3 = Surface.Area(surface=bySweep2Rails)
watch_3 = Watch(area_3)

# group: Punkte aus Fläche extrahieren und verwenden
code_block = CodeBlock { 0..1..0.1; }
# note: Zum Ableiten von Kanten, Punkten und anderen Merkmalen aus Oberflächen können die für die jeweilige Geometrie geeigneten Aktionen verwendet werden
pointAtParameter = Surface.PointAtParameter(surface=bySweep2Rails, u=code_block, v=code_block, lacing=CrossProduct)
# note: Erstellen Sie eine neue NURBS-Fläche anhand der extrahierten Parameter (Punkte).
# Blenden Sie die restlichen Geometrien aus, um das Ergebnis der folgenden Geometrie zu sehen.
byControlPoints = NurbsSurface.ByControlPoints(controlVertices=pointAtParameter)
watch_3d = Watch3D(byControlPoints)

# group: Extrusion
code_block_2 = CodeBlock { 10; }
# note: Einfache Extrusion aus der angegebenen Kurve
extrude = Curve.Extrude(curve=byThreePoints_2, distance=code_block_2)
