# Dynamo graph ImportExport_CSV to Stuff.dyn (Dynamo 3.1.0.3411)
# author: Dynamo Team
# Geometrie basierend auf analysierten CSV-Daten erstellen

# group: Anfängliche helix.csv-Eingabe
# note: Durchsuchen einer CSV-Datei mit Zahlen
# im X/Y/Z-Koordinatenraum
file_path = Filename("..\..\Data\helix.csv")

# group: Datei lesen
fromPath = FileObject(path=file_path)  # "File.FromPath"
readText = FileSystem.ReadText(file=fromPath)

# group: CSV-Daten analysieren
string = StringInput("\n")
# note: Zeichenfolge am
# Zeilenumbruch <Eingabe> teilen
split = String.Split(string=readText, separator0=string)
string_2 = StringInput(",")
# note: Zeichenfolge an Komma teilen
split_2 = String.Split(string=split, separator0=string_2)
# note: CSV-Dateien liefern Zeichenfolgen, keine Zahlen
toNumber = String.ToNumber(string=split_2)
# note: X-/Y-/Z-Komponenten gruppieren
transpose = List.Transpose(lists=toNumber)

# group: Geometrie des 'Übergangsbogens' basierend auf den abgerufenen Punkten aus der CSV-Datei erstellen
# note: 'X'-Koordinate
firstItem = List.FirstItem(list=transpose)
code_block = CodeBlock { 1; }
# note: 'Y'-Koordinate
getItemAtIndex = List.GetItemAtIndex(list=transpose, index=code_block)
# note: 'Z'-Koordinate
lastItem = List.LastItem(list=transpose)
byCoordinates = Point.ByCoordinates(x=firstItem, y=getItemAtIndex, z=lastItem)

# group: Vergrößern
number_slider = DoubleSlider(2.337, range=0..20 step 0.1)
# note: Gesamtverteilung der
# Koordinatenpunkte anpassen
scale = Geometry.Scale(geometry=byCoordinates, amount=number_slider, lacing=Longest)
