# Dynamo graph ImportExport_Excel to Dynamo.dyn (Dynamo 3.1.0.3411)
# author: Dynamo Team
# Beispiel-Diagramm, das zeigt, wie Daten aus Excel in Dynamo importiert werden.

# group: Anfängliche Eingaben
# note: Navigieren Sie zum XLSX-Excel-Dateipfad, aus dem Daten geladen werden sollen.
file_path = Filename("..\..\Data\helix.xlsx")
# note: Rufen Sie die Datei aus dem Dateipfad ab.
fromPath = FileObject(path=file_path)  # "File.FromPath"
# note: Name des Excel-Arbeitsblatts, das die zu importierenden Daten enthält.
string = StringInput("helix")

# group: Excel-Daten importieren
# note: Dieser Block kann Daten aus Excel-Arbeitsblättern lesen. Er liest alle Spalten und Zeilen, deren resultierende Daten in einem Doppel-Array [][] (Matrix) enthalten sind.
importExcel = Data.ImportExcel(file=fromPath, sheetName=string)

# group: Umstellen
# note: Kehren Sie die Liste (die Matrix) um (Umstellen). Die Spalten werden zu Zeilen und die Zeilen zu Spalten.
transpose = List.Transpose(lists=importExcel)

# group: Koordinaten der Punkte extrahieren
number = DoubleInput(0)
# note: X-Koordinate
getItemAtIndex = List.GetItemAtIndex(list=transpose, index=number)
number_2 = DoubleInput(1)
# note: Y-Koordinate
getItemAtIndex_2 = List.GetItemAtIndex(list=transpose, index=number_2)
number_3 = DoubleInput(2)
# note: Z-Koordinate
getItemAtIndex_3 = List.GetItemAtIndex(list=transpose, index=number_3)

# group: Helix basierend auf den extrahierten Daten aus Excel erstellen
byCoordinates = Point.ByCoordinates(x=getItemAtIndex, y=getItemAtIndex_2, z=getItemAtIndex_3, lacing=Longest)
