# Dynamo graph OpenXMLExport_Data To Excel.dyn (Dynamo 3.0.3.7594)
# author: Dynamo Team
# Dynamo-Beispieldiagramm, das zeigt, wie Daten nach Excel exportiert werden.

# group: Anfängliche Eingaben
# note: Steuert die Anzahl der Punkte. Stellen Sie sich dies als die Höhe der Helix vor.
number_slider = DoubleSlider(1.7, range=0..5 step 0.1)

# group: Helix erstellen
# note: Erstellen Sie eine Reihe von Zahlen, beginnend bei 0. Das Inkrement ist 10. Die Anzahl der Punkte wird mit 360 multipliziert. Wenn also die Eingabe 'numCircles' den Wert 1 hat, umfasst das Ergebnis 37 Zahlen (0 bis 360), und die Helix wird vollständig gedreht.
code_block = CodeBlock(numCircles=number_slider) { 0..(360*numCircles)..10; }
# note: Kosinusfunktion
cos = Math.Cos(angle=code_block, lacing=Longest)
# note: Sinusfunktion
sin = Math.Sin(angle=code_block, lacing=Longest)
# note: Division durch 100
code_block_2 = CodeBlock(x=code_block) { x/100; }
# note: Erstellen Sie eine Liste mit Punkten. Die X-Komponente ist der Kosinus, die Y-Komponente ist der Sinus und die Z-Komponente ist der anfängliche Wert, geteilt durch 100.
byCoordinates = Point.ByCoordinates(x=cos, y=sin, z=code_block_2, lacing=Longest)
# note: Erstellen Sie eine Listenstruktur aus der Liste mit Punkten. Das Ergebnis ist eine Liste mit 3 Listen ([][] - doppeltes Array), die jeweils die X-, Y- und Z-Punktkoordinaten enthalten.
code_block_3 = CodeBlock(pt=byCoordinates) { [pt.X,pt.Y,pt.Z]; }

# group: Eingaben für den Export erstellen
# 1. Dateipfad zur CSV-Datei.
# 2. Name des Arbeitsblatts.
# 3. Umgestellte Liste mit Punkten.
# 4. Startindex für die Zeile und Spalte in Excel.
# note: Dateipfad zur XLSX-Datei.
file_path = Filename("..\..\Data\icosohedron_points.xlsx")
# note: Name des Arbeitsblatts in Excel.
string = StringInput("helix")
# note: Kehren Sie die Matrix um (Liste umstellen). Spalten werden zu Zeilen und Zeilen zu Spalten.
transpose = List.Transpose(lists=code_block_3)
# note: Anzahl der Spalten/Zeilen, mit denen die Aufzeichnung der Daten in Excel begonnen werden soll
number = DoubleInput(0)

# group: Daten in Excel-Datei exportieren
# note: Exportiert Daten nach Excel
openXMLExportExcel = Data.OpenXMLExportExcel(filePath=file_path, sheetName=string, data=transpose, startRow=number, startColumn=number)
