# Dynamo graph OpenXMLImport_Data From Excel.dyn (Dynamo 3.1.0.3411)
# author: Dynamo Team
# Beispieldiagramm, das zeigt, wie Daten aus einer Excel-Datei importiert werden.

# group: Anfängliche Eingaben
# 1. Dateipfad zur Excel-Datei.
# 2. Name des Arbeitsblatts
file_path = Filename("..\..\Data\helix.xlsx")
string = StringInput("helix")

# group: Extrahiert Daten aus Excel
# note: Daten aus Excel lesen
openXMLImportExcel = Data.OpenXMLImportExcel(filePath=file_path, sheetName=string)

# group: Daten aus Excel analysieren
# Das Analysieren von Daten ist der Vorgang, bei dem eine Datenquelle so bearbeitet wird, dass sie für die Umgebung als nativ angesehen wird, bevor sie verwendet wird.
# note: Stellen Sie die Liste um (Matrix umkehren). Spalten werden zu Zeilen und Zeilen zu Spalten.
transpose = List.Transpose(lists=openXMLImportExcel)
# note: erste Liste
number = DoubleInput(0)
# note: zweite Liste
number_2 = DoubleInput(1)
# note: dritte Liste
number_3 = DoubleInput(2)

# group: Helix erstellen
# note: X-Koordinate
getItemAtIndex = List.GetItemAtIndex(list=transpose, index=number)
# note: Y-Koordinate
getItemAtIndex_2 = List.GetItemAtIndex(list=transpose, index=number_2)
# note: Z-Koordinate
getItemAtIndex_3 = List.GetItemAtIndex(list=transpose, index=number_3)
byCoordinates = Point.ByCoordinates(x=getItemAtIndex, y=getItemAtIndex_2, z=getItemAtIndex_3, lacing=Longest)
