# Dynamo graph Revit_GeometryCreation_Surfaces.dyn (Dynamo 2.19.3.6543)
# author: Dynamo Team
# In diesem Diagramm werden verschiedene Methoden zum Erstellen von Flächen in Dynamo sowie zwei Methoden zum Konvertieren von Geometrie in Revit-Geometrie vorgestellt.

# group: Info
# note: In diesem Diagramm werden verschiedene Methoden zum Erstellen von Oberflächengeometrie in Revit verwendet. Einige Methoden können in einer Projektumgebung, andere nur in bestimmten Familienumgebungen verwendet werden.
# Verwenden Sie eine Entwurfskörper-Familienvorlage, um alle Methoden anzuzeigen.
# Erstellen Sie eine Entwurfskörperfamilie, indem Sie Datei > Neu > Familie und dann die Vorlage Mass.rft im Ordner Conceputal Mass auswählen.
# note: Für die meisten Flächen stehen mehrere Erstellungsmethoden zur Verfügung. Flächen, Polysurfaces (Sammlungen von Flächen) und NURBS-Oberflächen können mithilfe von Punkten und Kurven erstellt und aus anderen Flächen und Volumenkörpern durch verschiedene Operationen abgeleitet werden.
# note: Um Geometrie in die Revit-Umgebung zu integrieren, muss sie zunächst in ein Revit-Element konvertiert werden.
# Flächen und Volumenkörper können in ein Importexemplar umgewandelt werden, das sowohl in der Projekt- als auch in der Modellfamilienumgebung sichtbar ist.
# Die Oberflächengeometrie kann auch in ein Formelement umgewandelt werden, das nur für Entwurfskörper- und adaptive Bauteilfamilienumgebungen verfügbar ist.

# group: Punkte vorbereiten
# Punktmenge zum Erstellen von Geometrie generieren
number = DoubleInput(10)
byCoordinates = Point.ByCoordinates(y=number)
number_2 = DoubleInput(5)
number_3 = DoubleInput(10)
byCoordinates_2 = Point.ByCoordinates(x=number_2, y=number_3, z=number_3)
number_4 = DoubleInput(15)
byCoordinates_3 = Point.ByCoordinates(x=number_4, y=number_4)
byCoordinates_4 = Point.ByCoordinates()
number_5 = DoubleInput(5)
byCoordinates_5 = Point.ByCoordinates(z=number_5)
byCoordinates_6 = Point.ByCoordinates(x=number)
number_6 = DoubleInput(-5)
number_7 = DoubleInput(5)
byCoordinates_7 = Point.ByCoordinates(x=number_6, y=number_7)
number_8 = DoubleInput(10)
number_9 = DoubleInput(-10)
byCoordinates_8 = Point.ByCoordinates(x=number_8, y=number_9)
byCoordinates_9 = Point.ByCoordinates(y=number_9)

# group: Profile erstellen
byThreePoints = Arc.ByThreePoints(firstPoint=byCoordinates, secondPoint=byCoordinates_2, thirdPoint=byCoordinates_3)
byThreePoints_2 = Arc.ByThreePoints(firstPoint=byCoordinates_4, secondPoint=byCoordinates_5, thirdPoint=byCoordinates_6)
byThreePoints_3 = Arc.ByThreePoints(firstPoint=byCoordinates_4, secondPoint=byCoordinates_7, thirdPoint=byCoordinates)
byStartPointEndPoint = Line.ByStartPointEndPoint(startPoint=byCoordinates_8, endPoint=byCoordinates_9)

# group: Fläche durch Sweeping
# Profil, Pfadkurve und Führungsschiene zum Erstellen einer Sweeping-Fläche verwenden
bySweep2Rails = Surface.BySweep2Rails(path=byThreePoints, guideRail=byThreePoints_2, profile=byThreePoints_3)

# group: Import erstellen
# note: Verwenden Sie Importexemplar, um Revit-Importe aus Flächen und Volumenkörpern zu erstellen. Diese werden in jeder Revit-Umgebung angezeigt.
byGeometries = ImportInstance.ByGeometries(geometries=bySweep2Rails)

create = List.Create(item0=byStartPointEndPoint, item1=byThreePoints_2)

# group: Fläche durch Erhebung erstellen
# Querschnitte verbinden, um eine erhabene Fläche zu erstellen
byLoft = Surface.ByLoft(crossSections=create)

# group: Oberflächenbereich auswerten
area = Surface.Area(surface=byLoft)
watch = Watch(area)
create_2 = List.Create(item0=byLoft, item1=bySweep2Rails)
# note: Zu Polysurfaces verbundene Oberflächen können als einzelnes Objekt ausgewertet werden.
byJoinedSurfaces = PolySurface.ByJoinedSurfaces(surfaces=create_2)
area_2 = Surface.Area(surface=byJoinedSurfaces)
watch_2 = Watch(area_2)
area_3 = Surface.Area(surface=bySweep2Rails)
watch_3 = Watch(area_3)

# group: NURBS-Oberfläche anhand von Steuerpunkten
# Sweeping anhand von Steuerpunkten in eine NURBS-Oberfläche konvertieren
code_block = CodeBlock { 0..1..0.1; }
# note: Kanten, Punkte und andere Elemente können aus Flächen abgeleitet werden, indem Sie für diese Geometrien geeignete Aktionen verwenden.
pointAtParameter = Surface.PointAtParameter(surface=bySweep2Rails, u=code_block, v=code_block, lacing=CrossProduct)
# note: Fläche anhand von Steuerpunkten als NURBS-Oberfläche neu konstruieren
byControlPoints = NurbsSurface.ByControlPoints(controlVertices=pointAtParameter)
# note: Vorschau der isolierten Geometrie mithilfe des 3D-Watch-Blocks anzeigen
watch_3d = Watch3D(byControlPoints)

# group: Fläche durch Extrusionskurve
# Kurve verwenden, um eine Extrusion mit einem bestimmten Abstand zu erstellen
code_block_2 = CodeBlock { 10; }
extrude = Curve.Extrude(curve=byThreePoints, distance=code_block_2)

# group: Form erstellen
# Erhebungsform aus zwei Kurven erstellen
referenceCurveByCurve = ModelCurve.ReferenceCurveByCurve(curve=create)
byLoftCrossSections = Form.ByLoftCrossSections(curves=referenceCurveByCurve)
