# Dynamo graph Basics_Basic01.dyn (Dynamo 2.19.3.6543)
# author: Dynamo Team
# Connect nodes to add two numbers

# note: Basic functional inputs, like Numbers and Strings can be selected by either browsing or searching from the library on the left of the canvas.
# Operations to execute on data, like math or geometric transformations, are also found in the library
# note: Dynamo is a Visual Programming language.  Like other languages it works by linking simple elements together to form more complex ideas
# note: Pull a connector out of the ">" port on the Number node and connect it to the "y" port on the + node, then push the "Run" button in the lower left corner of the application.
number = DoubleInput(2)  # graph input
add = number + _  # unwired: y
# note: Data Can be visualized by clicking on the Run button in the lower right of the application.  If you enable "Automatic" Run mode, the application will constantly update.
# You can see the data either by using a Watch node or clicking on the small square at the bottom of most nodes.
watch = Watch(add)
# note: More Sample files can be found in the Help menu, or close this file by clicking the "X" on the tab to return to the welcome page
number_2 = DoubleInput(6)  # graph input
