# Dynamo graph Core_CodeBlocks.dyn (Dynamo 3.4.1.7055)
# author: Dynamo Team
# This graph explores varios uses and applications of Code Blocks

# group: Info
# note: CODE BLOCKS
# Code Blocks can be created by double-clicking in the canvas. A Code Block can also be found in the node Library under Script > Editor category.
# Code Blocks can hold:
# •   Numeric values (integers and floating point numbers)
# •  Strings (text)
# •  Boolean values (True or False)
# •  Lists  [0,1,2]
# •  Expressions (a+3)
# •  Variables
# Other nodes can be transformed into a Code Block expression: select one or multiple nodes and right-click in the space between the nodes to select 'Node to code'. There is no reverse equivalent to this action - code blocks cannot be automatically transformed into nodes.

# group: Nodes as Code Blocks
# note: Code Blocks can be used to call any other node in the library. Nodes in the library generally come in three types:
#     Create:	create something
#     Action:	perform an action on something
#     Query:		get a property of something
# 		that already exists
# Methods, or nodes, of these three types are treated differently when invoked within a Code Block.

# group: Geometry creation
# note: Together, these statements form an algorithm that creates a helical curve at a base point.
code_block = CodeBlock()
# ---------- code_block.designscript (16 lines) ----------
// Basic inputs
base = Point.ByCoordinates(3,3);
coils = 3;
height = 5;
rad = 0.5;

// Make a series of points
numPts = 8*coils + 1;
seq = 0..(coils*360)..#numPts;
x = rad * Math.Cos(seq);
y = rad * Math.Sin(seq);
z = 0..height..#numPts;
pts = Point.ByCoordinates(x + base.X, y + base.Y, z + base.Z);

// Pass a curve through those points
NurbsCurve.ByPoints(pts);
# ----------------------------------------
# note: The helix algorithm is transformed into a function by giving it a name, specifying the inputs, and telling it what to return.
code_block_2 = CodeBlock()
# ---------- code_block_2.designscript (13 lines) ----------
def MakeSpring(base,coils,height,rad)
{
// Make a series of points
numPts = 8*coils + 1;
seq = 0..(coils*360)..#numPts;
x = rad * Math.Cos(seq);
y = rad * Math.Sin(seq);
z = 0..height..#numPts;
pts = Point.ByCoordinates(x + base.X, y + base.Y, z + base.Z);

// Return the curve that passes through those points
return = NurbsCurve.ByPoints(pts);
};
# ----------------------------------------
code_block_3 = CodeBlock { 0..6..2; }
code_block_4 = CodeBlock { 10..20..2; }
# note: The helix algorithm is transformed to define a function with the arbitrary name "MakeSpring".  This function is called to make several springs, with random heights, arranged in a grid.
# note: makes a grid
byCoordinates = Point.ByCoordinates(x=code_block_3, y=code_block_4, lacing=CrossProduct)
flatten = List.Flatten(list=byCoordinates)
code_block_5 = CodeBlock { 5; }
count = List.Count(list=flatten)
# note: makes a series of random numbers (scaled by 5) for the spring heights
randomList = Math.RandomList(amount=count)
code_block_6 = CodeBlock(random=randomList) { random * 5; }
# note: Inputs to function calls can be made with lists of things or single-value items. Data can be passed in through a port or declared directly, as in the case of "0.5" for the radii of all springs.
code_block_7 = CodeBlock(basePoints=flatten, numCoils=code_block_5, height=code_block_6) { MakeSpring(basePoints,numCoils,height,0.5); }

# group: Functions
# note: Functions can be defined directly in a Code Block node to be called elsewhere in this definition.
# The first line has the key word "def", then the function name, then the inputs in parentheses.
# Curly braces define the body of the function.  Each line must end in a semicolon.
# Return a value with "return = ".
code_block_8 = CodeBlock()
# ---------- code_block_8.designscript (11 lines) ----------
/* This is a multi-line comment,
     which continues for mulitple
     lines. */

def FunctionName(input1, input2)
{
// This is a comment
sum = input1 + input2;

return = sum;
};
# ----------------------------------------
code_block_9 = CodeBlock { 1; }
# note: Code Block nodes that define a function do not have input or output ports because they are called from other Code Block nodes.
code_block_10 = CodeBlock { 2; }
# note: Call the function with another Code Block node in the same file by giving the same name and the same number of arguments.
code_block_11 = CodeBlock(in1=code_block_9, in2=code_block_10) { FunctionName(in1,in2); }
watch = Watch(code_block_11)
code_block_12 = CodeBlock { "cat"; }
code_block_13 = CodeBlock { "dog"; }
# note: The type of the input arguments is not specified in the function definition, so it will operate on whatever it receives.
code_block_14 = CodeBlock(in1=code_block_12, in2=code_block_13) { FunctionName(in1,in2); }
watch_2 = Watch(code_block_14)
origin = Point.Origin()
code_block_15 = CodeBlock { 16; }
# note: A function call with inputs that do not make sense for that function will give a null result.
code_block_16 = CodeBlock(in1=origin, in2=code_block_15) { FunctionName(in1,in2); }
watch_3 = Watch(code_block_16)

# group: Numeric Values
# Compare the purpose-built nodes with Code Block
# note: Purpose-built
number = DoubleInput(3.14)
result = Watch(number)
# note: Code Block
code_block_17 = CodeBlock { 3.140; }
watch_4 = Watch(code_block_17)

# group: String Values
# Compare the purpose-built nodes with Code Block
# note: Purpose-built
string = StringInput("Less is more.")
result_2 = Watch(string)
# note: Use quotes "" to make a string with a Code Block node
code_block_18 = CodeBlock { "Less is more."; }
watch_5 = Watch(code_block_18)
# note: Use this node to view the ouput value type
type = Object.Type(object=code_block_18)
watch_6 = Watch(type)

# group: Expressions
# Perform a multiplication operation using purpose-built * node and using Code Block
number_2 = DoubleInput(3)
number_3 = DoubleInput(5)
# note: Multiply two numbers using * node
mul = number_2 * number_3
result_3 = Watch(mul)
# note: Perform multiplication using a Code Block
code_block_19 = CodeBlock { 3*5; }
watch_7 = Watch(code_block_19)
code_block_20 = CodeBlock { 3; }
code_block_21 = CodeBlock { 5; }
# note: Use variables as inputs for the multiplication operation.
code_block_22 = CodeBlock(a=code_block_20, b=code_block_21) { a*b; }
watch_8 = Watch(code_block_22)

# group: Query
# Methods that query and return a property of an object
# note: With Code Blocks, a user has flexibility to decide how to specify inputs.  Here are several different ways, for example, to make the same point.
code_block_23 = CodeBlock { 10; }
code_block_24 = CodeBlock { -10; }
# note: Out-of-the-box method using Point.ByCoordinates node
byCoordinates_2 = Point.ByCoordinates(x=code_block_23, y=code_block_24)
watch_9 = Watch(byCoordinates_2)
# note: Code Block uses a Point.ByCoordinates method with three variables for X, Y and Z, where Z is defined within the same Code Block and separated by a semicolon ';' symbol
code_block_25 = CodeBlock(x=code_block_23, y=code_block_24) { z = 0; Point.ByCoordinates(x,y,z); }
watch_10 = Watch(code_block_25.out1)
code_block_26 = CodeBlock { Point.ByCoordinates(10,0,0); }
# note: a Code Block equivalent of the same method. Query methods require no parentheses
code_block_27 = CodeBlock(pt=code_block_26) { pt.X; }
watch_11 = Watch(code_block_27)
# note: Out-of-the-box query method that returns the X coordinate of the point
X = Point.X(point=code_block_26)
watch_12 = Watch(X)
# note: A formula of using a negative value of the same numeric value here is integrated into the notation for input variables
code_block_28 = CodeBlock(num=code_block_23) { Point.ByCoordinates(num,-num,0); }
watch_13 = Watch(code_block_28)
# note: Code Block uses a Point.ByCoordinates method, all three variables are provided as input
code_block_29 = CodeBlock { Point.ByCoordinates(10,-10,0); }
watch_14 = Watch(code_block_29)

# group: Create
# Methods that create geometry, lists, Revit elements or other objects
# note: Out-of-the-box method of creating a point at origin
origin_2 = Point.Origin()
watch_15 = Watch(origin_2)
# note: Although this method needs no inputs, the parentheses are required
code_block_30 = CodeBlock { Point.Origin(); }
watch_16 = Watch(code_block_30)
code_block_31 = CodeBlock { 0; -10; }
# note: Out-of-the-box method of creating a point by providing X and Y coordinates
byCoordinates_3 = Point.ByCoordinates(x=code_block_31.out0, y=code_block_31.out1)
watch_17 = Watch(byCoordinates_3)
# note: Use a Code Block to replicate the Point.ByCoordinates node behaviour. You'll find the method name if you hover your mouse over the original out-of-the-box node : the method is mentioned at the bottom of the tooltip window.
# The inputs must be specified in the order found in the out-of-the-box node.
code_block_32 = CodeBlock { Point.ByCoordinates(0,-10); }
watch_18 = Watch(code_block_32)

# group: Action
# Methods that execute an action on an object
origin_3 = Point.Origin()
ZAxis = Vector.ZAxis()
# note: Out-of-the-box method of adding a vector to a point
add = Point.Add(point=origin_3, vectorToAdd=ZAxis)
watch_19 = Watch(add)
origin_4 = Point.Origin()
ZAxis_2 = Vector.ZAxis()
# note: Action methods are performed on an object. Use dot notation after the object itself and specify the method and all of the inputs found on the out-of-the-box node except for the first one (since the first input port is the object itself, which you already have!)
code_block_33 = CodeBlock(pt=origin_4, vector=ZAxis_2) { pt.Add(vector); }
watch_20 = Watch(code_block_33)

# group: Create Lists
# note: Create a lists using square brackets to define the list and commas to separate individual elements
code_block_34 = CodeBlock { ["San Francisco","New York","Chicago"]; }
watch_21 = Watch(code_block_34)
# note: Get items from a list using the following notation: list [ i ], where i is the index of the item. This method is identical to using the GetItemAtIndex node
code_block_35 = CodeBlock(cities=watch_21) { cities[2]; }
watch_22 = Watch(code_block_35)
# note: Multiple variables are defined in this code block, and at the end, a list is created containing all of them.
code_block_36 = CodeBlock()
# ---------- code_block_36.designscript (7 lines) ----------
str0 = "alpha";
str1 = "beta";
str2 = "charlie";
str3 = "delta";
str4 = "echo";
//
[str0,str1,str2,str3,str4];
# ----------------------------------------
watch_23 = Watch(code_block_36.out5)
code_block_37 = CodeBlock(phonetic=watch_23) { phonetic[2..3]; }
watch_24 = Watch(code_block_37)
code_block_38 = CodeBlock { 2; }
getItemAtIndex = List.GetItemAtIndex(list=watch_21, index=code_block_38)
watch_25 = Watch(getItemAtIndex)

# group: Combine lists and access list items
# note: Create nested lists and get items from nested lists.
code_block_39 = CodeBlock()
# ---------- code_block_39.designscript (6 lines) ----------
kitchen = ["table","stove","sink","refrigerator"];
livingRoom = ["sofa","books"];
bedroom = ["bed","dirty clothes"];
bathroom = ["tooth brush"];
//
allMyStuff = [kitchen, livingRoom, bedroom, bathroom];
# ----------------------------------------
watch_26 = Watch(code_block_39.allMyStuff)
# note: Access the second item inside the third list (or, in other words, access the item with index '1' inside the list with index '2')
code_block_40 = CodeBlock(list=watch_26) { list[2][1]; }
watch_27 = Watch(code_block_40)

# group: Replication
# note: Replication guides can be used to specify that lists be laced as a "cross product."
code_block_41 = CodeBlock { x_vals = 0..10; y_vals = -30..-40; }
code_block_42 = CodeBlock(x_vals=code_block_41.x_vals, y_vals=code_block_41.y_vals) { Point.ByCoordinates(x_vals, y_vals); }
code_block_43 = CodeBlock { x_vals = 0..10; y_vals = -15..-25; }
code_block_44 = CodeBlock(x_vals=code_block_43.x_vals, y_vals=code_block_43.y_vals) { Point.ByCoordinates(x_vals<1>, y_vals<2>); }
byCoordinates_4 = Point.ByCoordinates(x=code_block_41.x_vals, y=code_block_41.y_vals)
byCoordinates_5 = Point.ByCoordinates(x=code_block_43.x_vals, y=code_block_43.y_vals, lacing=CrossProduct)
# note: Replication guides, which use angle brackets, take two or three one-dimensional collections, and pair
# the elements together to generate a one, two- or three-dimensional collection.
# note: In this example, there are 2 x-values and 5 y-values.  Replications guides can specify that the resultant combination is 2 lists of 5 points or 5 lists of 2 points.
code_block_45 = CodeBlock()
# ---------- code_block_45.designscript (5 lines) ----------
x_vals = 0..1;
y_vals = -3..-7;
//
Point.ByCoordinates(x_vals<1>, y_vals<2>);
Point.ByCoordinates(x_vals<2>, y_vals<1>);
# ----------------------------------------
watch_28 = Watch(code_block_45.out2)
watch_29 = Watch(code_block_45.out3)

# group: Boolean
# Compare the purpose-built nodes with Code Block
# note: Boolean Toggle node
boolean = BoolSelector(true)
watch_30 = Watch(boolean)
# note: use 'true' or 'false' values in a Code Block to achieve the same result
code_block_46 = CodeBlock { true; }
watch_31 = Watch(code_block_46)
