# Dynamo graph Core_ListAtLevel.dyn (Dynamo 3.1.0.3411)
# author: Dynamo Team
# We explore List@Level and how it can be used to achieve the same results as List.Map node. We create a series of panels to demonstrate how List@Level really works.

# group: Info
# note: To determine which level of the list you want to work with, look at the bottom of the preview bubble or watch node and follow the lines from the List@Level notation up.

# group: Info
# General information for using List@Level
# note: LIST@LEVEL
# List@Level replaces the functionality of List.Map, by allowing you to directly select the level of list you want to work with.
# note: To change the list level you're working with, click the arrow beside the list input port and enable the "Use levels" option.
# When List@Level is first enabled on an input port, the list at the second innermost level (L2) is selected to be worked with.

# group: Info
# How this graph works
# note: We want to create panels in the interior of the grid. To do so, we will need to obtain the points at indexes 1 and 2 of each list in the innermost level. This can easily be done by using the List@Level feature. The grouping of the lists are kept by enabling the option "Keep list structure". But, first, let's inspect the list we created with Point.ByCoordinates a bit more to determine which level of the list we want to use.

# group: Inputs
code_block = CodeBlock { 0..30..#8; 12..0..#4; }
# note: In this example, we create a 3D list containing a series of points. There are 8 lists at L3, and each list contains another 4 lists (L2). Each of the 4 lists contains 4 points (L1), resulting in a total of 128 points.
byCoordinates = Point.ByCoordinates(x=code_block.out0, y=code_block.out1, z=code_block.out1, lacing=CrossProduct)

# group: Replacing List.Map with List@Level
code_block_2 = CodeBlock { [1,2]; }
# note: In the previous version of Dynamo, List.Map is used to obtain the inner levels of lists. Even though the same result can be achieved using List.Map, it introduces more nodes into the workspace. Here we use List@Level to grab interior points of the grid in a more efficient way. We will use these points to create panels.
# We also utilized the "Keep List Structure" option to maintain the groupings of the initial list and prevent flattening. If "Keep List Structure" is disabled, a single NurbsSurface will be created instead of eight.
getItemAtIndex = List.GetItemAtIndex(list=byCoordinates@@L2, index=code_block_2)
code_block_3 = CodeBlock { [1,2]; }
# note: The lists exist at different levels, with L1 being the lowest level. The total number of elements produced by this node is 64, as shown at the bottom right.
getItemAtIndex_2 = List.GetItemAtIndex(index=code_block_3)  # unwired: list
# note: Below is the List.Map equivalent to applying List@Level which requires additional nodes
map = List.Map(f_x=getItemAtIndex_2)  # unwired: list
map_2 = List.Map(list=byCoordinates, f_x=map)

# group: Creating Geometry
# note: With the sets of points selected, we can now create panels.
byPoints = NurbsSurface.ByPoints(points=getItemAtIndex)
byBestFitThroughPoints = Line.ByBestFitThroughPoints(bestFitPoints=getItemAtIndex)

# group: Inspecting a List with List@Level and Count
# note: The List.Count node returns the number of elements that are present in each list. Depending on the selected level, different values are returned. Try changing the value of L3 by clicking on the arrows beside it.
# note: There are eight lists at L3, each containing four lists. Hence, selecting L3 implements the List.Count function on the eight lists, giving eight '4' values.
count = List.Count(list=byCoordinates@L3)

# group: Using "Keep List Structure"
# note: This node returns the number of elements that are present in each list in L2. By default, the results are flattened into a 1D list.
count_2 = List.Count(list=byCoordinates@L2)
# note: To preserve the nested structure of the lists, select the option "Keep list structure". "@@" indicates how to keep the list structure in Designscript.
count_3 = List.Count(list=byCoordinates@@L2)

# group: Inspecting a List with List@Level and Flatten
# note: As an additional example, you can easily flatten the nested structure at inner levels of the lists by making use of the List@Level feature, together with the Flatten node. Try changing which level will be flattened by clicking on the arrows beside in the List@Level spinner.
# note: Selecting L3 converts the eight lists at that level into a 1D array. As each of the eight lists contains four items (which are also lists), this will flatten all of the lists at L3 producing eight lists of 16 points.
flatten = List.Flatten(list=byCoordinates@L3)
