# Dynamo graph Core_PassingFunctions.dyn (Dynamo 3.1.0.3411)
# author: Dynamo Team
# Demonstrates how to pass a function in Dynamo

# group: Info
# note: PASSING FUNCTIONS
# Dynamo is a functional language, which means that ACTIONS can be treated in the same way that OBJECTS are.  Most nodes in Dynamo can be turned into a function and used in a very precise way on a set of data.
# Making a function and passing a function is like speaking the command "Run for 20 minutes!" but specifying later on who you are talking to.
# In this example, a grid of circles is represented in a complex structure.  The command to select a set of circles is used directly, and then the command is passed instead as a function to lower levels of data for a different result.

# group: Initial inputs
# Create a 5x8 matrix of points
code_block = CodeBlock { 0..#8..4; }
code_block_2 = CodeBlock { 0..#5..4; }
byCoordinates = Point.ByCoordinates(x=code_block, y=code_block_2, lacing=CrossProduct)

# group: Draw matrix of circles
# note: This list of points is organized in a hierarchical structure--it's a list of lists.  The grid was made with 8 points in the X-direction and 5 in the Y-direction.  This list represents 8 lists of 5 things, or lists of columns of points.
watch = Watch(byCoordinates)
code_block_3 = CodeBlock { 1.5; }
# note: Draw a circle around each point.
byCenterPointRadius = Circle.ByCenterPointRadius(centerPoint=watch, radius=code_block_3)

# group: Select the second and the third LIST
# Passing the function
code_block_4 = CodeBlock { 1..2; }
# note: From the nested list of circles, items {1,2} are chosen.  Dynamo nodes will always act on a list "from the outside in," or from the highest level to the lowest level.
# Selecting items 1 and 2 from the list will return list #1 and list #2 from the original nested list structure.
getItemAtIndex = List.GetItemAtIndex(list=byCenterPointRadius, index=code_block_4)

# group: Extrude UP
# Resulting cylinders
# note: The selected data still exists in the same structure it did before I selected it by mapping.
watch_2 = Watch(getItemAtIndex)
code_block_5 = CodeBlock { 3; }
# note: This list of circles is extruded up.
extrude = Curve.Extrude(curve=watch_2, distance=code_block_5)

# group: Select the second and the third ITEM from EACH LIST
# Passing the function
code_block_6 = CodeBlock { 1..2; }
# note: Rather than taking the first two lists from the node's output, the List@Level feature allows the #1 and #2 item from EACH list to be taken, by selecting L2 at the input port of List.GetItemAtIndex.
# Note that this feature resolves the functionality of List.Map, a method used to access the inner levels of input lists in the previous versions of Dynamo.
getItemAtIndex_2 = List.GetItemAtIndex(list=byCenterPointRadius@L2, index=code_block_6)

# group: Extrude DOWN
# Resulting cylinders
watch_3 = Watch(getItemAtIndex_2)
code_block_7 = CodeBlock { -3; }
# note: This list of circles is extruded down.
extrude_2 = Curve.Extrude(curve=watch_3, distance=code_block_7)
