# Dynamo graph Core_RangeSyntax.dyn (Dynamo 3.0.0.6964)
# author: Dynamo Team
# This graph provides several ways to generate series of equally spaced numbers or characters.

# group: Info
# note: Range Syntax
# There are several way to create lists as sequences of numbers or characters.
# Sequences can come in handy when creating arrays of elements, iterations, and as preparation for various functions and equasions.

# group: Using Code Block
# note: start..end..step
# From 0 to 10 with a step of 2
# This method is equivalent to using the Range node
code_block = CodeBlock { 0..10..2; }
watch = Watch(code_block)
# note: start..end
# When the step value is not specified, it is assumed to be 1.
# This method is identical to using the Range node
# note: Use range syntax in a Code Block node. There are several And you have several methods to generate series of numbers (or characters):
#         start..end..step
#         start..end..#amount
#         start..#amount..interval
# start = number/character starting the series
# end = number/character ending the series
# step = difference between two consecutive numbers/characters
# amount = how many numbers/characters are in the series
code_block_2 = CodeBlock { 0..10; }
watch_2 = Watch(code_block_2)
# note: start..end..#amount
# From 0 to 10 in 3 steps
code_block_3 = CodeBlock { 0..10..#3; }
watch_3 = Watch(code_block_3)
# note: start..#amount..interval
# 10 steps starting from 0, each step equal to 3
# This method is equivalent to using the Sequence node
code_block_4 = CodeBlock { 0..#10..3; }
watch_4 = Watch(code_block_4)

# group: Use Code Block with dynamic input
integer_slider = IntegerSlider(7, range=0..10 step 1)
# note: Substitute a value with a variable and use a slider to dynamically control the length of the list.
code_block_5 = CodeBlock(howMany=integer_slider) { 0..#howMany..3; }
watch_5 = Watch(code_block_5)

# group: Using Sequence
number = DoubleInput(0)
number_slider = DoubleSlider(8, range=0..10 step 0.1)
number_2 = DoubleInput(2)
# note: Use a Sequence node if the number of items in the list and the length of each step are known.  The last result in the list is not pre-defined, but calculated based on other inputs.
# Example: designing a parking lot with spaces for 8 cars and a know width of each parking space. The overall width of all parking spaces is dependant on the individual widths and number of spaces.
sequence = Sequence(start=number, amount=number_slider, step=number_2, lacing=Longest)
watch_6 = Watch(sequence)

# group: Using Range
number_3 = DoubleInput(0)
number_4 = DoubleInput(10)
number_slider_2 = DoubleSlider(1.75, range=0..10 step 0.1)
# note: Use a Range node if the start and end of the sequence are known. The number of items in the resulting list is not pre-defined, but calculated, based on other inputs.
# It's worth noting that the last item in the list might not match the 'end' input if the step value extends beyond the 'end' when surpassing it by an additional step.
# Increasing the step value between set 'start' and 'end' may result in fewer items, and viceversa, reducing the step will increase the length of the list.
range = Range(start=number_3, end=number_4, step=number_slider_2, lacing=Longest)
watch_7 = Watch(range)

# group: Using Range - with Strings
string = StringInput("A")
string_2 = StringInput("P")
code_block_6 = CodeBlock { 1; }
# note: Range can be used to generate sequences of characters too!
range_2 = Range(start=string, end=string_2, step=code_block_6, lacing=Longest)
watch_8 = Watch(range_2)

# group: Using Sequence - with Strings
string_3 = StringInput("A")
code_block_7 = CodeBlock { 20; }
# note: Use a Sequence node to generate a series of letters in alphabetic order
sequence_2 = Sequence(start=string_3, amount=code_block_7)
watch_9 = Watch(sequence_2)

# note: Use the  sequence of values to create a series of points
byCoordinates = Point.ByCoordinates(x=code_block_5)
