# Dynamo graph Core_Strings.dyn (Dynamo 3.4.1.7055)
# author: Dynamo Team
# This graph demonstrates actions that can be performed on strings.

# group: Info
# note: STRINGS
# This set of examples demonstrates some actions that can be performed with Strings. More nodes for String operations can be found in the nodel Library under the 'String' category

byCoordinates = Point.ByCoordinates()
code_block = CodeBlock { 5; }
# note: Create an object - a circle
byCenterPointRadius = Circle.ByCenterPointRadius(centerPoint=byCoordinates, radius=code_block)

# group: Convert object into String
# note: Convert an object to a string decription of itself.
string_from_object = FromObject(obj=byCenterPointRadius)

watch = Watch(string_from_object)

# group: Split string using separators
code_block_2 = CodeBlock { "("; ")"; " "; "="; ","; }
# note: Divide a string into pieces by specifying one or more separator characters. Each separator can be one or multiple characters.
split = String.Split(string=watch, separator0=code_block_2.out0, separator1=code_block_2.out1, separator2=code_block_2.out2, separator3=code_block_2.out3, separator4=code_block_2.out4)

watch_2 = Watch(split)

# group: Check if String contains substring
code_block_3 = CodeBlock { "."; }
# note: Find whether a string contains another string.
contains = String.Contains(string=watch_2, searchFor=code_block_3)

watch_3 = Watch(contains)

# group: Create string
# note: Use a Code Block to create a string - "" marks delimit the string value.
code_block_4 = CodeBlock { "Few things are harder to put up with than a good example."; }

# group: Change to UPPERCASE
string = StringInput(" - Mark Twain")
# note: Change the case of a string
toUpper = String.ToUpper(string=string)
watch_4 = Watch(toUpper)

# group: Concatenate
# note: Attaching two strings together to make one is called "concatenating," or "concat" for short.
concat = String.Concat(string0=code_block_4, string1=watch_4)

watch_5 = Watch(concat)

# group: Replace characters in a string
code_block_5 = CodeBlock { "put"; }
code_block_6 = CodeBlock { "come"; }
# note: Substiture all occurences of a substring with a replacement string.
replace = String.Replace(string=watch_5, searchFor=code_block_5, replaceWith=code_block_6)

watch_6 = Watch(replace)

# group: Locate a substring in a string
code_block_7 = CodeBlock { " to"; }
# note: Find where a particular substring occurs in a string. The result is the index where the substring begins.
indexOf = String.IndexOf(string=watch_6, searchFor=code_block_7)
watch_7 = Watch(indexOf)

# group: String length
# note: Find the total number of characters in a string.
length = String.Length(string=watch_6)
watch_8 = Watch(length)

# note: Subtract the first part of the string from the total length of the string
sub = watch_8 - watch_7

# group: Remove characters
# note: Remove a certain number of characters from a string.
remove = String.Remove(string=watch_6, startIndex=watch_7, count=sub)

# group: Count occurencies
watch_9 = Watch(remove)
code_block_8 = CodeBlock { "ar"; }
# note: Count the occurences of a substring inside a string.
countOccurrences = String.CountOccurrences(string=watch_9, searchFor=code_block_8)
watch_10 = Watch(countOccurrences)

# group: Create string
# note: If the string includes a " character, use an escape character \ before " to treat it as a part of the string and not the end of the string.
code_block_9 = CodeBlock { "There is no \"I\" in Team"; }
watch_11 = Watch(code_block_9)

range_of_numbers = CodeBlock { 2..101; }

# group: Concatenate strings using 'Add'
code_block_10 = CodeBlock { " Dalmatians"; }
# note: 'Add' operation automatically converts numbers into strings and performs concatenation
add = range_of_numbers + code_block_10
watch_12 = Watch(add)

# group: Convert object into string
# note: In some situation it's necessary to first convert an object into a string
string_from_object_2 = FromObject(object=range_of_numbers)
watch_13 = Watch(string_from_object_2)
type = Object.Type(object=string_from_object_2)
watch_14 = Watch(type)

# group: Convert string into number
code_block_11 = CodeBlock { "101 Dalmatians"; }
code_block_12 = CodeBlock { " "; }
# note: Split the string into words using space as a separator
split_2 = String.Split(string=code_block_11, separator0=code_block_12)
# note: Get the first item from a list
firstItem = List.FirstItem(list=split_2)
# note: Convert the string into a number
toNumber = String.ToNumber(string=firstItem)
watch_15 = Watch(toNumber)
type_2 = Object.Type(object=toNumber)
watch_16 = Watch(type_2)

# group: Convert the strings to numbers
# note: Use the boolean list as a mask for a filter to get all numbers in a list
filterByBoolMask = List.FilterByBoolMask(list=watch_2, mask=contains)
# note: Convert the strings to numbers
toNumber_2 = String.ToNumber(string=filterByBoolMask.in)

watch_17 = Watch(filterByBoolMask.in)
