# Dynamo graph Geometry_Curves.dyn (Dynamo 3.1.0.3411)
# author: Dynamo Team
# A sample graph demonstrating how to create the basic Curve primitives - Line, Polycurve, open and closed Nurbs curve

# group: Info
# note: This graph demonstrates how to create the basic Curve primitives - Line, Polycurve, open and closed Nurbs curve

# group: Initial inputs
number = DoubleInput(5)
number_2 = DoubleInput(10)
number_3 = DoubleInput(15)

# group: Initial 4 points
byCoordinates = Point.ByCoordinates()
byCoordinates_2 = Point.ByCoordinates(y=number)
byCoordinates_3 = Point.ByCoordinates(x=number_2, y=number_2)
byCoordinates_4 = Point.ByCoordinates(x=number_3)

# group: List of 4 points
create = List.Create(item0=byCoordinates, item1=byCoordinates_2, item2=byCoordinates_3, item3=byCoordinates_4)

# group: Nurbs curve
# note: Creates a Nurbs curve by 4 points
byPoints = NurbsCurve.ByPoints(points=create)

# group: Line
# note: Single straight line by 2 points
byStartPointEndPoint = Line.ByStartPointEndPoint(startPoint=byCoordinates, endPoint=byCoordinates_2)

length = Curve.Length(curve=byStartPointEndPoint)

# group: Nurbs curve - closed
boolean = BoolSelector(true)
# note: Create a closed Nurbs curve inside the bounding points
byControlPoints = NurbsCurve.ByControlPoints(points=create, closeCurve=boolean)

# group: Polycurve
# note: Create a straight polycurve through a set of points
byPoints_2 = PolyCurve.ByPoints(points=create)

# group: Actions and Queries
code_block = CodeBlock { 0..1..#20; }
# note: Curves, Polycurves (collections of Curves), Nurbs, and Lines all derive from "Curves", and so all Curve "Actions" and "Queries" can be done to all of them
pointAtParameter = Curve.PointAtParameter(curve=byPoints_2, param=code_block)
