# Dynamo graph Geometry_Points.dyn (Dynamo 3.1.0.3411)
# author: Dynamo Team
# Create Points array

# group: Initial inputs
number_slider = DoubleSlider(6.4, range=0..10 step 0.1)

# group: Single point
# note: Basic Geometric Elements have default values for numerical inputs. Check the default values by hovering over the node input port
byCoordinates = Point.ByCoordinates(z=number_slider)

# group: Preview results
# note: After hitting "Run" or with Run Automatically enabled, see the geometric entity either in the Background Peview, in Watch 3D, or as data in a Watch node.  Elements will highlight in Background when the node is selected
watch_3d = Watch3D(byCoordinates)

# group: Initial inputs
number = DoubleInput(0)
number_2 = DoubleInput(10)
number_3 = DoubleInput(1)

# group: Range of numbers
# note: Arrays of Geometry can be created using Sequences, Ranges, and Lists
range = Range(start=number, end=number_2, step=number_3, lacing=Longest)

# group: Matrix of points
# note: Make 1, 2, and 3 dimensional arrays by passing Ranges into the points x, y, and z ports, then changing the Lacing properties in the right click menu for the node. Observe the result when choosing the Cross Product Lacing option
byCoordinates_2 = Point.ByCoordinates(x=range, y=range, lacing=CrossProduct)

watch = Watch(byCoordinates)

# group: Turn point into Vector
# note: Some elements can be easily converted into others
asVector = Point.AsVector(point=watch)

# group: Move matrix by the point as a vector
# note: Derivative elements can be created by using tools in the Actions subcategory of the entity
add = Point.Add(point=byCoordinates_2, vectorToAdd=asVector)

# group: Preview point 'Z' coordinate
# note: Information can be extracted from Geometry using nodes in the Query subcategory of each node grouping (next to the questionmark symbol)
Z = Point.Z(point=byCoordinates)
