# Dynamo graph Geometry_Surfaces.dyn (Dynamo 3.1.0.3411)
# A Dynamo graph showcasing the primary ways of creating surfaces - Extrude, Loft and Sweep.

# group: Info
# note: A Dynamo graph showcasing the primary ways of creating surfaces - Extrude, Loft and Sweep

# group: Input
number = DoubleInput(10)
number_2 = DoubleInput(-10)
byCoordinates = Point.ByCoordinates(x=number, y=number_2)
byCoordinates_2 = Point.ByCoordinates(y=number_2)

# group: Line
byStartPointEndPoint = Line.ByStartPointEndPoint(startPoint=byCoordinates, endPoint=byCoordinates_2)

# group: Input
byCoordinates_3 = Point.ByCoordinates()

# group: Input
number_3 = DoubleInput(5)
byCoordinates_4 = Point.ByCoordinates(z=number_3)

# group: Input
number_4 = DoubleInput(10)
byCoordinates_5 = Point.ByCoordinates(x=number_4)
byCoordinates_6 = Point.ByCoordinates(y=number_4)

# group: Arc
byThreePoints = Arc.ByThreePoints(firstPoint=byCoordinates_3, secondPoint=byCoordinates_4, thirdPoint=byCoordinates_5)

# group: Loft
create = List.Create(item0=byStartPointEndPoint, item1=byThreePoints)
# note: Using the 2 sets of curves, we can create a 'Loft' geometry between them
byLoft = Surface.ByLoft(crossSections=create)

# group: Evaluate Loft Area
area = Surface.Area(surface=byLoft)
watch = Watch(area)

# group: Input
number_5 = DoubleInput(5)
number_6 = DoubleInput(10)
byCoordinates_7 = Point.ByCoordinates(x=number_5, y=number_6, z=number_6)

# group: Input
number_7 = DoubleInput(15)
byCoordinates_8 = Point.ByCoordinates(x=number_7, y=number_7)

# group: Arc
byThreePoints_2 = Arc.ByThreePoints(firstPoint=byCoordinates_6, secondPoint=byCoordinates_7, thirdPoint=byCoordinates_8)

# group: Input
number_8 = DoubleInput(-5)
number_9 = DoubleInput(5)
byCoordinates_9 = Point.ByCoordinates(x=number_8, y=number_9)

# group: Arc
byThreePoints_3 = Arc.ByThreePoints(firstPoint=byCoordinates_3, secondPoint=byCoordinates_9, thirdPoint=byCoordinates_6)

# group: Sweep
# note: Multiple creation methods exist for most Surfaces.  Surfaces, Polysurfaces (collections of Surfaces), and Nurbs Surfaces can be create by Points, Curves, and derived from other surfaces and solids
bySweep2Rails = Surface.BySweep2Rails(path=byThreePoints_2, guideRail=byThreePoints, profile=byThreePoints_3)

# group: Combine the Loft and the Sweep
create_2 = List.Create(item0=byLoft, item1=bySweep2Rails)
# note: Surfaces Joined as Polysurfaces can be evalued as a single entity
byJoinedSurfaces = PolySurface.ByJoinedSurfaces(surfaces=create_2)

# group: Evaluate the combined Loft + Sweep Area
area_2 = Surface.Area(surface=byJoinedSurfaces)
watch_2 = Watch(area_2)

# group: Evaluate Sweep Area
area_3 = Surface.Area(surface=bySweep2Rails)
watch_3 = Watch(area_3)

# group: Extract and use points from surface
code_block = CodeBlock { 0..1..0.1; }
# note: Edges, Points and other features can be derived from Surfaces using "Actions" appropriate to those geometries
pointAtParameter = Surface.PointAtParameter(surface=bySweep2Rails, u=code_block, v=code_block, lacing=CrossProduct)
# note: Create a new Nurbs surface by the extracted parameters (points).
# Hide the rest of the geometries to observe the result of the one below.
byControlPoints = NurbsSurface.ByControlPoints(controlVertices=pointAtParameter)
watch_3d = Watch3D(byControlPoints)

# group: Extrude
code_block_2 = CodeBlock { 10; }
# note: A basic extrudion from the provided curve
extrude = Curve.Extrude(curve=byThreePoints_2, distance=code_block_2)
