# Dynamo graph ImportExport_CSV to Stuff.dyn (Dynamo 3.1.0.3411)
# author: Dynamo Team
# Create gometry based on parsed csv data

# group: Initial helix.csv input
# note: Browse a CSV file that has numbers
# in x, y, and z coordinate space
file_path = Filename("..\..\Data\helix.csv")

# group: Read the file
fromPath = FileObject(path=file_path)  # "File.FromPath"
readText = FileSystem.ReadText(file=fromPath)

# group: Parse the csv data
string = StringInput("\n")
# note: Split the String on
# A carriage return <enter>
split = String.Split(string=readText, separator0=string)
string_2 = StringInput(",")
# note: Split the String on Comma
split_2 = String.Split(string=split, separator0=string_2)
# note: CSV files supply Strings, not numbers
toNumber = String.ToNumber(string=split_2)
# note: Group X, Y, & Z components
transpose = List.Transpose(lists=toNumber)

# group: Create the 'spiral' geometry based on the retrieved points from the csv file
# note: 'X' coordinate
firstItem = List.FirstItem(list=transpose)
code_block = CodeBlock { 1; }
# note: 'Y' coordinate
getItemAtIndex = List.GetItemAtIndex(list=transpose, index=code_block)
# note: 'Z' coordinate
lastItem = List.LastItem(list=transpose)
byCoordinates = Point.ByCoordinates(x=firstItem, y=getItemAtIndex, z=lastItem)

# group: Scale up
number_slider = DoubleSlider(2.337, range=0..20 step 0.1)
# note: Adjust the overall distribution
# of the coordinate points
scale = Geometry.Scale(geometry=byCoordinates, amount=number_slider, lacing=Longest)
