# Dynamo graph AutoCAD_RunScriptCommandToChangeLayers.dyn "RunScriptCommandToChangeLayers" (Dynamo 2.1.1.7865)

# group: change layers of objects via run script command
original_layers = CodeBlock { "0"; }
current = Autodesk.AutoCAD.DynamoNodes.Document.Current()
modelSpace = Autodesk.AutoCAD.DynamoNodes.Document.ModelSpace(document=current)
layers_needed = CodeBlock { "C-ROAD"; }

all_objects_on_layer = AcObjectsOnLayer(layer=original_layers, block=modelSpace)

# group (continued): change layers of objects via run script command
setLayer = Autodesk.AutoCAD.DynamoNodes.Object.SetLayer(object=all_objects_on_layer, layer=layers_needed)
