# Dynamo graph Basics_Basic02.dyn (Dynamo 2.19.3.6543)
# author: Dynamo Team
# Create a line by connecting two points

# note: Manipulate the position of the point in the Dynamo environment : Select the Point.ByCoordinates node and swicth to Background preview to pull the point along its three axes.
byCoordinates = Point.ByCoordinates()
# note: Geometric Data can be visualized as either textual information or in 3d space
watch = Watch(byCoordinates)
number = DoubleInput(2)  # graph input
# note: Use a Number Slider or Integer Slider nodes to dynamically input a value within a specified range. Click on the blue dropdown arrow to open the numeric range settings
number_slider = DoubleSlider(4.43, range=0..10 step 0.1)  # graph input
# note: You can toggle between 3D Background navigation and Graph View navigation with the butttons in the upper right corner of the screen (Ctrl + B shortcut). Background Preview can also be turned on and off in the View Menu, for Dynamo and Revit.
byCoordinates_2 = Point.ByCoordinates(x=number, z=number_slider)
byStartPointEndPoint = Line.ByStartPointEndPoint(startPoint=byCoordinates_2, endPoint=byCoordinates)
# note: Use Watch 3D node to visualise the 3D element in isolation
watch_3d = Watch3D(byStartPointEndPoint)
