# Dynamo graph Civil3D_AddTextAndCircleAlongCorridorFeatureLine.dyn "AddTextAndCircleAlongCorridorFeatureLine" (Dynamo 2.1.1.7865)

# group: GetCorridorFeatureLine
current = Autodesk.AutoCAD.DynamoNodes.Document.Current()
code_block = CodeBlock { ["Crown", "ETW","Daylight"]; }

corridors = Corridors(document=current)
rebuild = Autodesk.Civil.DynamoNodes.Corridor.Rebuild(corridor=corridors)

# group (continued): GetCorridorFeatureLine
baselines = Autodesk.Civil.DynamoNodes.Corridor.Baselines(corridor=rebuild)
corridorFeatureLinesByCode = Autodesk.Civil.DynamoNodes.Baseline.CorridorFeatureLinesByCode(baseline=baselines, code=code_block, lacing=CrossProduct)
points = Autodesk.Civil.DynamoNodes.CorridorFeatureLine.Points(corridorFeatureLine=corridorFeatureLinesByCode)
stations = Autodesk.Civil.DynamoNodes.Baseline.Stations(baseline=baselines)

code_block_2 = CodeBlock { 2; }
flatten = List.Flatten(list=stations, amt=code_block_2)
modelSpace = Autodesk.AutoCAD.DynamoNodes.Document.ModelSpace(document=current)

# group: Create Text
code_block_3 = CodeBlock { 3; }
flatten_2 = List.Flatten(list=points, amt=code_block_3)
Z = Point.Z(point=flatten_2)
string_from_object = FromObject(obj=Z)
code_block_4 = CodeBlock { 2; }
coordinateSystemByStation = Autodesk.Civil.DynamoNodes.CorridorFeatureLine.CoordinateSystemByStation(corridorFeatureLine=corridorFeatureLinesByCode@L1, station=flatten)
YAxis = CoordinateSystem.YAxis(coordinateSystem=coordinateSystemByStation)
code_block_5 = CodeBlock { "textLayer"; }
create = Autodesk.AutoCAD.DynamoNodes.Text.Create(text=string_from_object, insertionPoint=flatten_2, height=code_block_4, rotation=YAxis, layer=code_block_5, block=modelSpace)

# group: Create circle in C3D
code_block_6 = CodeBlock { 2; }
byCenterPointRadiusNormal = Circle.ByCenterPointRadiusNormal(centerPoint=flatten_2, radius=code_block_6)
code_block_7 = CodeBlock { "textLayer"; }
byGeometry = Autodesk.AutoCAD.DynamoNodes.Circle.ByGeometry(geometry=byCenterPointRadiusNormal, layer=code_block_7, block=modelSpace)
