# Dynamo graph Civil3D_CorridorCounterfortWall.dyn "CorridorCounterfortWall" (Dynamo 2.1.1.7865)

# group: Retainwall shape
code_block = CodeBlock { 3; 1; }
byCoordinates = Point.ByCoordinates(x=code_block.out0)
byCoordinates_2 = Point.ByCoordinates()
list_create = List.Create(item0=byCoordinates, item1=byCoordinates_2)
byCoordinates_3 = Point.ByCoordinates(x=code_block.out1)
list_create_2 = List.Create(item0=byCoordinates_3, item1=byCoordinates_2)
list_create_3 = List.Create(item0=list_create, item1=list_create_2)
code_block_2 = CodeBlock { -3; -1; }
byCoordinates_4 = Point.ByCoordinates(x=code_block_2.out0)
byCoordinates_5 = Point.ByCoordinates()
list_create_4 = List.Create(item0=byCoordinates_4, item1=byCoordinates_5)
byCoordinates_6 = Point.ByCoordinates(x=code_block_2.out1)
list_create_5 = List.Create(item0=byCoordinates_6, item1=byCoordinates_5)
list_create_6 = List.Create(item0=list_create_4, item1=list_create_5)
list_create_7 = List.Create(item0=list_create_3, item1=list_create_6)

# group: Get attachment points of Top and Bottom of the wall
code_block_3 = CodeBlock { "Corridor - (1)"; }
current = Autodesk.AutoCAD.DynamoNodes.Document.Current()
corridorByName = Autodesk.Civil.DynamoNodes.Selection.CorridorByName(name=code_block_3, document=current)
baselines = Autodesk.Civil.DynamoNodes.Corridor.Baselines(corridor=corridorByName)
code_block_4 = CodeBlock(a=baselines) { a[0]; }
code_block_5 = CodeBlock { ["RW_Hinge","RW_Back"]; }
corridorFeatureLinesByCode = Autodesk.Civil.DynamoNodes.Baseline.CorridorFeatureLinesByCode(baseline=code_block_4, code=code_block_5)
transpose = List.Transpose(lists=corridorFeatureLinesByCode)
startStation = Autodesk.Civil.DynamoNodes.Baseline.StartStation(baseline=code_block_4)
endStation = Autodesk.Civil.DynamoNodes.Baseline.EndStation(baseline=code_block_4)
code_block_6 = CodeBlock(s=startStation, e=endStation) { s+20..e-20..10; }
coordinateSystemByStation = Autodesk.Civil.DynamoNodes.CorridorFeatureLine.CoordinateSystemByStation(corridorFeatureLine=transpose, station=code_block_6@L1)

modelSpace = Autodesk.AutoCAD.DynamoNodes.Document.ModelSpace(document=current)

# group: Generate Counterfort Wall
code_block_7 = CodeBlock(p1=list_create_7, cs=coordinateSystemByStation) { p1.Transform(cs<1>); }
byBestFitThroughPoints = Line.ByBestFitThroughPoints(bestFitPoints=code_block_7)
byLoft = Surface.ByLoft(crossSections=byBestFitThroughPoints)
code_block_8 = CodeBlock { 0.8; }
thicken = Surface.Thicken(surface=byLoft, thickness=code_block_8)
code_block_9 = CodeBlock { "0"; }
byGeometry = Autodesk.AutoCAD.DynamoNodes.Solid.ByGeometry(geometry=thicken, layer=code_block_9, block=modelSpace)
