# Dynamo graph Core_ListAtLevel.dyn (Dynamo 1.2.1.3083)

# note: The lists exist at different levels, with L1 being the lowest level. The total number of elements produced by this node is 65, as shown at the bottom right.
# note: This node produces a list containing 10 lists, each having 12 points, resulting in a total of 120 points.

code_block = CodeBlock { 0..30..#10; -10..-34..#12; }
byCoordinates = Point.ByCoordinates(x=code_block.out0, y=code_block.out1, lacing=CrossProduct)
code_block_2 = CodeBlock { {1..10}; }
# note: In this example, we select the second level of the lists resulted from the Point.ByCoordinates node. For each list in the second level, we select a point from it. The index of the point to be selected is determined from the code block.
# The point with index 1 is selected from the first list, the point with index 2 is selected from the second list, and so on. There are a total of 10 lists, hence 10 points are selected.
getItemAtIndex = List.GetItemAtIndex(list=byCoordinates@L2, index=code_block_2@L1)
ZAxis = Vector.ZAxis()
code_block_3 = CodeBlock { x = 0..180..#10; 7 + 5*Math.Cos(x); }
# note: Translate the selected points upwards, each having a different height.
translate = Geometry.Translate(geometry=getItemAtIndex, direction=ZAxis, distance=code_block_3.out1)
create = List.Create(getItemAtIndex, translate)
number = DoubleInput(1.5)
byCenterPointRadius = Circle.ByCenterPointRadius(centerPoint=create, radius=number)
transpose = List.Transpose(byCenterPointRadius)
byLoft = Surface.ByLoft(transpose)
patch = Curve.Patch(transpose)
# note: LIST@LEVEL
# The List@Level resolves the functionality of List.Map, by allowing you to directly select the level of list you want to work with.
code_block_4 = CodeBlock { x = {1..5, 1..5, 1..5}; }
code_block_5 = CodeBlock { 1..3; 5; }
mul = code_block_5.out0 * code_block_5.out1
# note: To change the list level you're working with, click the arrow beside the list input port and enable the "Use levels" option.
# By default, the list at the highest level is selected to be worked with.
# note: Here, we have a list containing three lists, each having five lists of numbers. The five lists contain multiples of 1 to 5 (first list has multiples of 1, second list has multiples of 2, and so on).
# Going up one level (to L3, where we have three lists), the range limit is set as 5 for the first list, 10 for the second list and 15 for the third list.
range = Range(start=code_block_4, end=mul, step=code_block_4, lacing=CrossProduct)

# group: Using "Keep list structure"
# note: This node returns the number of elements that are present in each list in L2. By default, the results are flattened into a 1D list.
count = List.Count(range@L2)
# note: To preserve the nested structure of the input lists, select the option "Keep list structure". "@@" indicates how to keep the list structure in DesignScript.
count_2 = List.Count(range@@L2)

# note: The List.Count node returns the number of elements that are present in each list. Depending on the selected level, different values are returned. Try changing the value of L3 by clicking on the arrows beside it.
# note: There are three lists at L3, each containing five lists. Hence, selecting L3 implements the List.Count function on the three lists, giving three '5' values.
count_3 = List.Count(range@L3)
code_block_6 = CodeBlock { 0..30..#8; 12..0..#4; }
# note: In this example, we create a 3D list containing a series of points. There are 8 lists at L3, and each list contains another 4 lists (L2). Each of the 4 lists contains 4 points (L1), resulting in a total of 128 points.
byCoordinates_2 = Point.ByCoordinates(x=code_block_6.out0, y=code_block_6.out1, z=code_block_6.out1, lacing=CrossProduct)
# note: We want to obtain the points at indexes 1 and 2 of each list in the innermost level. This can easily be done by using the List@Level feature. The grouping of the lists are kept by enabling the option "Keep list structure".
code_block_7 = CodeBlock { {1,2}; }
getItemAtIndex_2 = List.GetItemAtIndex(list=byCoordinates_2@@L2, index=code_block_7)
byPoints = NurbsSurface.ByPoints(getItemAtIndex_2)
byBestFitThroughPoints = Line.ByBestFitThroughPoints(getItemAtIndex_2)

# group: Comparing List@Level with List.Map
code_block_8 = CodeBlock { {1,2}; }
getItemAtIndex_3 = List.GetItemAtIndex(index=code_block_8)  # unwired: list
map = List.Map(f_x=getItemAtIndex_3)  # unwired: list
# note: In the previous version of Dynamo, List.Map is used to obtain the inner levels of lists. Even though the same result can be achieved using this method, it introduces more nodes into the workspace.
map_2 = List.Map(list=byCoordinates_2, f_x=map)

# note: As an additional example, you can easily flatten the nested structure at inner levels of the lists by making use of the List@Level feature, together with the Flatten node. Try changing the value of L3 by clicking on the arrows beside it.
# note: Selecting L3 converts the three lists at that level into a 1D array. As each of the three lists contains five items (which are also lists), this will turn L3 into a list containing 15 items (or lists) with indexes 0 to 14.
flatten = Flatten(range@L3)
