# Dynamo graph Core_ListAtLevel1.dyn (Dynamo 1.2.3.466)

# note: The lists exist at different levels, with L1 being the lowest level. The total number of elements produced by this node is 65, as shown at the bottom right.

# note: LIST@LEVEL
# The List@Level resolves the functionality of List.Map, by allowing you to directly select the level of list you want to work with.
code_block = CodeBlock { x = {1..5, 1..5, 1..5}; }
code_block_2 = CodeBlock { 1..3; 5; }
mul = code_block_2.out0 * code_block_2.out1
# note: To change the list level you're working with, click the arrow beside the list input port and enable the "Use levels" option.
# By default, the list at the highest level is selected to be worked with.
# note: Here, we have a list containing three lists, each having five lists of numbers. The five lists contain multiples of 1 to 5 (first list has multiples of 1, second list has multiples of 2, and so on).
# Going up one level (to L3, where we have three lists), the range limit is set as 5 for the first list, 10 for the second list and 15 for the third list.
range = Range(start=code_block, end=mul, step=code_block, lacing=CrossProduct)

# group: Using "Keep list structure"
# note: This node returns the number of elements that are present in each list in L2. By default, the results are flattened into a 1D list.
count = List.Count(range@L2)
# note: To preserve the nested structure of the lists, select the option "Keep list structure". "@@" indicates how to keep the list structure in Designscript.
count_2 = List.Count(range@@L2)

# note: The List.Count node returns the number of elements that are present in each list. Depending on the selected level, different values are returned. Try changing the value of L3 by clicking on the arrows beside it.
# note: There are three lists at L3, each containing five lists. Hence, selecting L3 implements the List.Count function on the three lists, giving three '5' values.
count_3 = List.Count(range@L3)
# note: As an additional example, you can easily flatten the nested structure at inner levels of the lists by making use of the List@Level feature, together with the Flatten node. Try changing the value of L3 by clicking on the arrows beside it.
# note: Selecting L3 converts the three lists at that level into a 1D array. As each of the three lists contains five items (which are also lists), this will turn L3 into a list containing 15 items (or lists) with indexes 0 to 14.
flatten = Flatten(range@L3)
