# Dynamo graph Core_ListAtLevel2.dyn (Dynamo 1.2.3.466)

code_block = CodeBlock { 0..30..#8; 12..0..#4; }
# note: In this example, we create a 3D list containing a series of points. There are 8 lists at L3, and each list contains another 4 lists (L2). Each of the 4 lists contains 4 points (L1), resulting in a total of 128 points.
byCoordinates = Point.ByCoordinates(x=code_block.out0, y=code_block.out1, z=code_block.out1, lacing=CrossProduct)
# note: We want to obtain the points at indexes 1 and 2 of each list in the innermost level. This can easily be done by using the List@Level feature. The grouping of the lists are kept by enabling the option "Keep list structure".
code_block_2 = CodeBlock { {1,2}; }
getItemAtIndex = List.GetItemAtIndex(list=byCoordinates@@L2, index=code_block_2)
byPoints = NurbsSurface.ByPoints(getItemAtIndex)
byBestFitThroughPoints = Line.ByBestFitThroughPoints(getItemAtIndex)

# group: Comparing List@Level with List.Map
code_block_3 = CodeBlock { {1,2}; }
getItemAtIndex_2 = List.GetItemAtIndex(index=code_block_3)  # unwired: list
map = List.Map(f_x=getItemAtIndex_2)  # unwired: list
# note: In the previous version of Dynamo, List.Map is used to obtain the inner levels of lists. Even though the same result can be achieved using this method, it introduces more nodes into the workspace.
map_2 = List.Map(list=byCoordinates, f_x=map)
