# Dynamo graph Core_ListAtLevel3.dyn (Dynamo 1.2.3.466)

# note: This node produces a list containing 10 lists, each having 12 points, resulting in a total of 120 points.

code_block = CodeBlock { 0..30..#10; -10..-34..#12; }
byCoordinates = Point.ByCoordinates(x=code_block.out0, y=code_block.out1, lacing=CrossProduct)
code_block_2 = CodeBlock { {1..10}; }
# note: In this example, we select the second level of the lists resulted from the Point.ByCoordinates node. For each list in the second level, we select a point from it. The index of the point to be selected is determined from the code block.
# The point with index 1 is selected from the first list, the point with index 2 is selected from the second list, and so on. There are a total of 10 lists, hence 10 points are selected.
getItemAtIndex = List.GetItemAtIndex(list=byCoordinates@L2, index=code_block_2@L1)
ZAxis = Vector.ZAxis()
code_block_3 = CodeBlock { x = 0..180..#10; 7 + 5*Math.Cos(x); }
# note: Translate the selected points upwards, each having a different height.
translate = Geometry.Translate(geometry=getItemAtIndex, direction=ZAxis, distance=code_block_3.out1)
create = List.Create(getItemAtIndex, translate)
number = DoubleInput(1.5)
byCenterPointRadius = Circle.ByCenterPointRadius(centerPoint=create, radius=number)
transpose = List.Transpose(byCenterPointRadius)
byLoft = Surface.ByLoft(transpose)
patch = Curve.Patch(transpose)
