# Dynamo graph Core_Math.dyn (Dynamo 2.13.0.3265)
# author: Dynamo Team
# Dynamo Core Sample

# note: Documentation for the formula node can be found at http://ncalc.codeplex.com/
code_block = CodeBlock { -10..10..#20; }
byCoordinates = Point.ByCoordinates(x=code_block, y=code_block, lacing=CrossProduct)
flatten = List.Flatten(list=byCoordinates)
Y = Point.Y(point=flatten)
# note: Moves the geometry over
code_block_2 = CodeBlock(x=Y) { x+60; }
X = Point.X(point=flatten)
number_slider = DoubleSlider(5.51, range=0..10 step 0.1)  # graph input
number_slider_2 = DoubleSlider(1.724, range=0..5 step 0.1)  # graph input
# note: The formula node, since it uses external functionalities, treats angles as radians.
formula = Formula("A * sin( sqrt( pow(x,2) + pow(y,2) + pow(c,2) ) ) / sqrt( pow(x,2) + pow(y,2) + pow(c,2) )", a=number_slider, x=X, y=Y, c=number_slider_2)
byCoordinates_2 = Point.ByCoordinates(x=code_block_2, y=X, z=formula)
count = List.Count(list=byCoordinates)
chop = List.Chop(list=byCoordinates_2, lengths=count)
byPoints = NurbsCurve.ByPoints(points=chop)
byLoft = Surface.ByLoft(crossSections=byPoints)
code_block_3 = CodeBlock { -10..10..#20; }
# note: Makes a grid of points.
# Note lacing behavior is
# "cross product."
# note: This example shows four different ways to approach dealing with Math functions.  Each of these examples starts with a grid of points, calculates z-coordinates for the points and then makes a surface.  Only the calculation method differs; these methods all solve the same.
# 1. Nodes. Math nodes are in Core/Math/
# 2. Python.
# 3. Formula Node. This is a separate open-source project made available through Dynamo. Documentation for the formula node can be found at http://ncalc.codeplex.com/
# 4. Code Block Node.  Double-click anywhere in the canvas to create a code block node.  Syntax for each function matches the name of the node in Dynamo.
# ** Note: You can adjust the resolution of the geometry preview through the Settings Menu.
# note: For more on this example:
# http://dynamobim.org/math-transit/
byCoordinates_3 = Point.ByCoordinates(x=code_block_3, y=code_block_3, lacing=CrossProduct)
# note: Tip: Adjust how precisely the geometry in the background preview is rendered.  In the settings menu, choose "Render Precision."  A higher value will make curved surfaces look smoother, but it will take more processing power to draw.
flatten_2 = List.Flatten(list=byCoordinates_3)
X_2 = Point.X(point=flatten_2)
Y_2 = Point.Y(point=flatten_2)
number_slider_3 = DoubleSlider(5.51, range=0..10 step 0.1)  # graph input
number = DoubleInput(2)  # graph input
pow = Math.Pow(number=X_2, power=number)
number_2 = DoubleInput(2)  # graph input
pow_2 = Math.Pow(number=Y_2, power=number_2)
add = pow + pow_2
number_slider_4 = DoubleSlider(1.724, range=0..5 step 0.1)  # graph input
number_3 = DoubleInput(2)  # graph input
pow_3 = Math.Pow(number=number_slider_4, power=number_3)
add_2 = add + pow_3
sqrt = Math.Sqrt(number=add_2)
# note: Angles in Dynamo are in Degrees
radiansToDegrees = Math.RadiansToDegrees(radians=sqrt)
sin = Math.Sin(angle=radiansToDegrees)
div = sin / sqrt
mul = number_slider_3 * div
byCoordinates_4 = Point.ByCoordinates(x=X_2, y=Y_2, z=mul)
count_2 = List.Count(list=byCoordinates_3)
# note: Divides flat list into series
# of lists by row
chop_2 = List.Chop(list=byCoordinates_4, lengths=count_2)
# note: Creates NURBS curves
# through points
byPoints_2 = NurbsCurve.ByPoints(points=chop_2)
# note: Creates a surface
byLoft_2 = Surface.ByLoft(crossSections=byPoints_2)
code_block_4 = CodeBlock { -10..10..#20; }
byCoordinates_5 = Point.ByCoordinates(x=code_block_4, y=code_block_4, lacing=CrossProduct)
flatten_3 = List.Flatten(list=byCoordinates_5)
Y_3 = Point.Y(point=flatten_3)
code_block_5 = CodeBlock(x=Y_3) { x+90; }
X_3 = Point.X(point=flatten_3)
number_slider_5 = DoubleSlider(1.724, range=0..5 step 0.1)  # graph input
number_slider_6 = DoubleSlider(5.51, range=0..10 step 0.1)  # graph input
# note: Names for math methods match the names of the Dynamo nodes used in the first example.
code_block_6 = CodeBlock(x=X_3, y=Y_3, c=number_slider_5, A=number_slider_6)
# ---------- code_block_6.designscript (6 lines) ----------
sum = Math.Pow(x,2) + Math.Pow(y,2) + Math.Pow(c,2);

num1 = Math.Sqrt(sum);
num2 = Math.Sin( Math.RadiansToDegrees(num1) );

A * num2 / num1;
# ----------------------------------------
byCoordinates_6 = Point.ByCoordinates(x=code_block_5, y=X_3, z=code_block_6.out3)
count_3 = List.Count(list=byCoordinates_5)
chop_3 = List.Chop(list=byCoordinates_6, lengths=count_3)
byPoints_3 = NurbsCurve.ByPoints(points=chop_3)
byLoft_3 = Surface.ByLoft(crossSections=byPoints_3)
code_block_7 = CodeBlock { -10..10..#20; }
byCoordinates_7 = Point.ByCoordinates(x=code_block_7, y=code_block_7, lacing=CrossProduct)
flatten_4 = List.Flatten(list=byCoordinates_7)
X_4 = Point.X(point=flatten_4)
code_block_8 = CodeBlock(x=X_4) { x+30; }
Y_4 = Point.Y(point=flatten_4)
number_slider_7 = DoubleSlider(5.51, range=0..10 step 0.1)  # graph input
number_slider_8 = DoubleSlider(1.724, range=0..5 step 0.1)  # graph input
python_script = Python(IN[0]=number_slider_7, IN[1]=X_4, IN[2]=Y_4, IN[3]=number_slider_8)  # CPython3
# ---------- python_script.python (27 lines) ----------
import clr
clr.AddReference('ProtoGeometry')
from Autodesk.DesignScript.Geometry import *

import math

# The inputs to this node will be stored as a list in the IN variable.
amp = IN[0]   # single value
x = IN[1]     # list
y = IN[2]     # list (expect same length as x)
c = IN[3]     # single value

# Declare an empty array of z-values
z = []

# Solve the equation for each x and y value
for index in range(len(x)):
	sum = math.pow(x[index],2) + math.pow(y[index],2) + math.pow(c,2)
	num1 = math.sqrt(sum)
	num2 = math.sin(num1)
	zVal = amp * num2 / num1
	
	# Append the answer to the list of z values
	z.append(zVal)

# Assign the z-values to the OUT variable
OUT = z
# ----------------------------------------
byCoordinates_8 = Point.ByCoordinates(x=code_block_8, y=Y_4, z=python_script)
count_4 = List.Count(list=byCoordinates_7)
chop_4 = List.Chop(list=byCoordinates_8, lengths=count_4)
byPoints_4 = NurbsCurve.ByPoints(points=chop_4)
byLoft_4 = Surface.ByLoft(crossSections=byPoints_4)
code_block_9 = CodeBlock { 25; 20; }
byCoordinates_9 = Point.ByCoordinates(x=code_block_9.out0, y=code_block_9.out1)
# note: Series of X-values
code_block_10 = CodeBlock { 0..10..#20; }
# note: Amplitude
number_slider_9 = DoubleSlider(3, range=0..10 step 0.1)  # graph input
# note: Frequency
number_slider_10 = DoubleSlider(36, range=0..100 step 0.1)  # graph input
code_block_11 = CodeBlock(amplitude=number_slider_9, frequency=number_slider_10, angle=code_block_10) { amplitude * Math.Cos(frequency * angle); }
byCoordinates_10 = Point.ByCoordinates(x=code_block_10, y=code_block_11)
code_block_12 = CodeBlock(base=byCoordinates_9, pts=byCoordinates_10)
# ---------- code_block_12.designscript (14 lines) ----------
// Make axes from base point
dimension = 10;
top = Point.ByCoordinates(base.X, base.Y + dimension/2);
bottom = Point.ByCoordinates(base.X, base.Y - dimension/2);
right = Point.ByCoordinates(base.X + 10, base.Y);
Line.ByStartPointEndPoint(bottom, top);
Line.ByStartPointEndPoint(base, right);

// Move function results to base point
vec = base.AsVector();
newPts = pts.Add(vec);

// Draw a line through the points
NurbsCurve.ByPoints(newPts);
# ----------------------------------------
code_block_13 = CodeBlock { -5; 20; }
byCoordinates_11 = Point.ByCoordinates(x=code_block_13.out0, y=code_block_13.out1)
code_block_14 = CodeBlock { 0..10..#20; }
# note: This set of examples shows how to graph a cosine function using nodes, the Formula node, and a Code Block.
# Each example takes a series of numbers as the x-values for a series of points, calculates the y-values from the x-values, and then draws a line in the shape of a cosine curve.  The large code block at the end of each graph moves the drawn geometry to a different part of the screen so that they are not all overlapping.
number_slider_11 = DoubleSlider(3, range=0..10 step 0.1)  # graph input
number_slider_12 = DoubleSlider(36, range=0..100 step 0.1)  # graph input
mul_2 = number_slider_12 * code_block_14
cos = Math.Cos(angle=mul_2)
mul_3 = number_slider_11 * cos
byCoordinates_12 = Point.ByCoordinates(x=code_block_14, y=mul_3)
code_block_15 = CodeBlock(base=byCoordinates_11, pts=byCoordinates_12)  # same code as code_block_12
# note: Tip: You can turn on or off the preview functionality for any node that makes geometry.  Right click and check or uncheck "Preview."
code_block_16 = CodeBlock { 10; 20; }
byCoordinates_13 = Point.ByCoordinates(x=code_block_16.out0, y=code_block_16.out1)
code_block_17 = CodeBlock { 0..10..#20; }
number_slider_13 = DoubleSlider(3, range=0..10 step 0.1)  # graph input
number_slider_14 = DoubleSlider(36, range=0..100 step 0.1)  # graph input
degreesToRadians = Math.DegreesToRadians(degrees=code_block_17)
# note: Formula nodes take angles in radians
formula_2 = Formula("amplitude * cos( frequency * angle)", amplitude=number_slider_13, frequency=number_slider_14, angle=degreesToRadians)
byCoordinates_14 = Point.ByCoordinates(x=code_block_17, y=formula_2)
# note: Tip: Selecting a node that draws geometry will turn the geometry it creates cyan.  This code block draws the axes of a graph, the points along the curve, and then the curve itself.  Select the code block to see in the background which curve it draws.
code_block_18 = CodeBlock(base=byCoordinates_13, pts=byCoordinates_14)  # same code as code_block_12
# note: Angles in nodes or Code Block are in radians.
code_block_19 = CodeBlock { 0; 35; }
byCoordinates_15 = Point.ByCoordinates(x=code_block_19.out0, y=code_block_19.out1)
code_block_20 = CodeBlock { 5; 0; }
# note: Move the slider to change the length of the arc.
number_slider_15 = DoubleSlider(247.821, range=0..360 step 0.1)  # graph input
ZAxis = Vector.ZAxis()
byCenterPointRadiusAngle = Arc.ByCenterPointRadiusAngle(center=byCoordinates_15, radius=code_block_20.out0, startAngle=code_block_20.out1, endAngle=number_slider_15, normal=ZAxis)
endPoint = Curve.EndPoint(curve=byCenterPointRadiusAngle)
byStartPointEndPoint = Line.ByStartPointEndPoint(startPoint=endPoint, endPoint=byCoordinates_15)
startPoint = Curve.StartPoint(curve=byCenterPointRadiusAngle)
byStartPointEndPoint_2 = Line.ByStartPointEndPoint(startPoint=startPoint, endPoint=byCoordinates_15)
code_block_21 = CodeBlock { 5; 2; }
# note: Arithmetic operators such as
# +, -, *, /, %
# note: MATH
# Math in Dynamo can be done with nodes from the Math library and the Operators library, with a Formula node, or with a Code Block.  Below, see how to perform several basic math operations with each of these three methods.
sub = code_block_21.out0 - code_block_21.out1
watch = Watch(sub)
code_block_22 = CodeBlock { 5-2; }
watch_2 = Watch(code_block_22)
formula_3 = Formula("5-2")  # graph input
watch_3 = Watch(formula_3)
code_block_23 = CodeBlock { 5%2; }
watch_4 = Watch(code_block_23)
formula_4 = Formula("5%2")  # graph input
watch_5 = Watch(formula_4)
code_block_24 = CodeBlock { 5; 2; }
mod = code_block_24.out0 % code_block_24.out1
watch_6 = Watch(mod)
code_block_25 = CodeBlock { 5<=2; }
watch_7 = Watch(code_block_25)
formula_5 = Formula("5<=2")  # graph input
watch_8 = Watch(formula_5)
code_block_26 = CodeBlock { 5>2; }
watch_9 = Watch(code_block_26)
formula_6 = Formula("5>2")  # graph input
watch_10 = Watch(formula_6)
code_block_27 = CodeBlock { 5; 2; }
le = code_block_27.out0 <= code_block_27.out1
watch_11 = Watch(le)
# note: Comparison operators such as
# <, >, <=, >=, !=, ==
code_block_28 = CodeBlock { 5; 2; }
gt = code_block_28.out0 > code_block_28.out1
watch_12 = Watch(gt)
code_block_29 = CodeBlock { 15; 35; }
byCoordinates_16 = Point.ByCoordinates(x=code_block_29.out0, y=code_block_29.out1)
number_slider_16 = DoubleSlider(126.947, range=0..360 step 0.1)  # graph input
code_block_30 = CodeBlock(center=byCoordinates_16, endAngle=number_slider_16) { Arc.ByCenterPointRadiusAngle(center,5,0,endAngle,Vector.ZAxis()); }
startPoint_2 = Curve.StartPoint(curve=code_block_30)
byStartPointEndPoint_3 = Line.ByStartPointEndPoint(startPoint=startPoint_2, endPoint=byCoordinates_16)
endPoint_2 = Curve.EndPoint(curve=code_block_30)
byStartPointEndPoint_4 = Line.ByStartPointEndPoint(startPoint=endPoint_2, endPoint=byCoordinates_16)
code_block_31 = CodeBlock { 3.14159; }
# note: Rounding
floor = Math.Floor(number=code_block_31)
watch_13 = Watch(floor)
ceiling = Math.Ceiling(number=code_block_31)
watch_14 = Watch(ceiling)
round = Math.Round(number=code_block_31)
watch_15 = Watch(round)
code_block_32 = CodeBlock { 3; }
round_2 = Math.Round(number=code_block_31, digits=code_block_32)
watch_16 = Watch(round_2)
code_block_33 = CodeBlock { 3.14159; }
code_block_34 = CodeBlock(num=code_block_33) { Math.Floor(num); }
watch_17 = Watch(code_block_34)
code_block_35 = CodeBlock(num=code_block_33) { Math.Ceiling(num); }
watch_18 = Watch(code_block_35)
code_block_36 = CodeBlock(num=code_block_33) { Math.Round(num); }
watch_19 = Watch(code_block_36)
code_block_37 = CodeBlock(num=code_block_33) { Math.Round(num,3); }
watch_20 = Watch(code_block_37)
code_block_38 = CodeBlock { 3.14159; }
formula_7 = Formula("floor(num)", num=code_block_38)
watch_21 = Watch(formula_7)
formula_8 = Formula("ceiling(num)", num=code_block_38)
watch_22 = Watch(formula_8)
formula_9 = Formula("round(num,3)", num=code_block_38)
watch_23 = Watch(formula_9)
formula_10 = Formula("round(num,0)", num=code_block_38)
watch_24 = Watch(formula_10)
formula_11 = Formula("true == false")  # graph input
watch_25 = Watch(formula_11)
formula_12 = Formula("!true")  # graph input
watch_26 = Watch(formula_12)
formula_13 = Formula("true && false")  # graph input
watch_27 = Watch(formula_13)
formula_14 = Formula("true || false")  # graph input
watch_28 = Watch(formula_14)
code_block_39 = CodeBlock { true == false; }
watch_29 = Watch(code_block_39)
code_block_40 = CodeBlock { !true; }
watch_30 = Watch(code_block_40)
code_block_41 = CodeBlock { true && false; }
watch_31 = Watch(code_block_41)
code_block_42 = CodeBlock { true || false; }
watch_32 = Watch(code_block_42)
# note: Boolean operators
# (Find others in the library.)
boolean = BoolSelector(true)  # graph input
boolean_2 = BoolSelector(false)  # graph input
eq = boolean == boolean_2
watch_33 = Watch(eq)
boolean_3 = BoolSelector(true)  # graph input
boolean_4 = BoolSelector(false)  # graph input
or_ = boolean_3 || boolean_4
watch_34 = Watch(or_)
boolean_5 = BoolSelector(true)  # graph input
boolean_6 = BoolSelector(false)  # graph input
and_ = boolean_5 && boolean_6
watch_35 = Watch(and_)
boolean_7 = BoolSelector(true)  # graph input
not_ = Not(x=boolean_7)
watch_36 = Watch(not_)
