# Dynamo graph Core_PassingFunctions.dyn (Dynamo 0.8.0.684)

# note: PASSING FUNCTIONS
# Dynamo is a functional language, which means that ACTIONS can be treated in the same way that OBJECTS are.  Most nodes in Dynamo can be turned into a function and used in a very precise way on a set of data.
# Making a function and passing a function is like speaking the command "Run for 20 minutes!" but specifying later on who you are talking to.
# In this example, a grid of circles is represented in a complex structure.  The command to select a set of circles is used directly, and then the command is passed instead as a function to lower levels of data for a different result.
code_block = CodeBlock { 0..#8..4; }
code_block_2 = CodeBlock { 0..#5..4; }
byCoordinates = Point.ByCoordinates(x=code_block, y=code_block_2, lacing=CrossProduct)
# note: This list of points is organized in a hierarchical structure--it's a list of lists.  The grid was made with 8 points in the X-direction and 5 in the Y-direction.  This list represents 8 lists of 5 things, or lists of columns of points.
watch = Watch(byCoordinates)
code_block_3 = CodeBlock { 1.5; }
# note: Draw a circle around each point.
byCenterPointRadius = Circle.ByCenterPointRadius(centerPoint=watch, radius=code_block_3)
# note: From the nested list of circles, items {1,2} are chosen.  Dynamo nodes will always act on a list "from the outside in," or from the highest level to the lowest level.
# Selecting items 1 and 2 from the list will return list #1 and list #2 from the original nested list structure.
code_block_4 = CodeBlock { 1..2; }
getItemAtIndex = List.GetItemAtIndex(list=byCenterPointRadius, index=code_block_4)
# note: The selected data still exists in the same structure it did before I selected it by mapping.
watch_2 = Watch(getItemAtIndex)
code_block_5 = CodeBlock { 3; }
# note: This list of circles is extruded up.
extrude = Curve.Extrude(curve=watch_2, distance=code_block_5)
code_block_6 = CodeBlock { 1..2; }
# note: List.GetItemAtIndex can be used as a function and passed TO EACH list.
# To turn List.GetItemAtIndex into a function, the list input is left UNSATISFIED and the node's output is passed to the function input for the List.Map node.  The List.Map function then takes the #1 and #2 item FROM EACH list rather than the first two lists.
getItemAtIndex_2 = List.GetItemAtIndex(index=code_block_6)
map = List.Map(list=byCenterPointRadius, f_x=getItemAtIndex_2)
watch_3 = Watch(map)
code_block_7 = CodeBlock { -3; }
# note: This list of circles is extruded down.
extrude_2 = Curve.Extrude(curve=watch_3, distance=code_block_7)
