# Dynamo graph Geometry_Solids.dyn (Dynamo 3.1.0.3411)
# author: Dynamo Team
# A Dynamo sample graph demonstrating solid creation using Loft and solid manipulation (addition and substraction)

# group: Initial points for the first group of curves
byCoordinates = Point.ByCoordinates()
number = DoubleInput(10)
byCoordinates_2 = Point.ByCoordinates(x=number)
byCoordinates_3 = Point.ByCoordinates(y=number)

# group: Aditional point for the second group of curves
number_2 = DoubleInput(5)
byCoordinates_4 = Point.ByCoordinates(z=number_2)

# group: Create the initial curves for the bottom base
byStartPointEndPoint = Line.ByStartPointEndPoint(startPoint=byCoordinates, endPoint=byCoordinates_2)
byThreePoints = Arc.ByThreePoints(firstPoint=byCoordinates, secondPoint=byCoordinates_4, thirdPoint=byCoordinates_2)

# group: Create bottom base
create = List.Create(item0=byStartPointEndPoint, item1=byThreePoints)
byJoinedCurves = PolyCurve.ByJoinedCurves(curves=create)

# group: Aditional point for the third group of curves
number_3 = DoubleInput(15)
byCoordinates_5 = Point.ByCoordinates(x=number_3, y=number_3)

# group: Aditional point for the forth group of curves
number_4 = DoubleInput(5)
number_5 = DoubleInput(10)
byCoordinates_6 = Point.ByCoordinates(x=number_4, y=number_5, z=number_5)

# group: Create the initial curves for the top base
byStartPointEndPoint_2 = Line.ByStartPointEndPoint(startPoint=byCoordinates_3, endPoint=byCoordinates_5)
byThreePoints_2 = Arc.ByThreePoints(firstPoint=byCoordinates_3, secondPoint=byCoordinates_6, thirdPoint=byCoordinates_5)

# group: Create top base
create_2 = List.Create(item0=byStartPointEndPoint_2, item1=byThreePoints_2)
byJoinedCurves_2 = PolyCurve.ByJoinedCurves(curves=create_2)

# group: Combine base curves into a list
create_3 = List.Create(item0=byJoinedCurves, item1=byJoinedCurves_2)

# group: Loft
# note: Multiple creation methods exist for most Solids.  These examples show Closed Profiles as the base, but polysurfaces can be stitched, many primitives are available (Surfaces, Cuboid, Cone, etc)
byLoft = Solid.ByLoft(crossSections=create_3)

# group: Volume
# note: You can check the volume of the loft demonstrating it is a closed solid geometry
volume = Solid.Volume(solid=byLoft)

# group: Aditional point for the additional loft geometry
number_6 = DoubleInput(-2)
number_7 = DoubleInput(5)
byCoordinates_7 = Point.ByCoordinates(x=number_6, y=number_7)

# group: Combine points into a list
create_4 = List.Create(item0=byCoordinates, item1=byCoordinates_7, item2=byCoordinates_3)

# group: Create aditional base curve
# note: This time createa a nurbse curve from the group of points
byPoints = NurbsCurve.ByPoints(points=create_4)

# group: Loft +
# note: Tip:  Turn off "Preview" in Node Right Click menus to exclude elements from Showing
byLoft_2 = Solid.ByLoft(crossSections=create_3, guideCurves=byPoints)

# group: Geometry +
code_block = CodeBlock { Vector.ByCoordinates(-20,0,0); }
# note: Move geometry to visualize output
translate = Geometry.Translate(geometry=byLoft_2, direction=code_block)

# group: Prepare the 'ingredients' to trim the Solid geometry
# note: Thickness
code_block_2 = CodeBlock { 0; }
# note: Tip:  Turn off "Preview" in Node Right Click menus to exclude elements from Showing
thinShell = Solid.ThinShell(solid=byLoft, internalFaceThickness=code_block_2)
code_block_3 = CodeBlock { Vector.ByCoordinates(20,0,0); }
# note: Move geometry in X direction by 20 units
translate_2 = Geometry.Translate(geometry=thinShell, direction=code_block_3)
code_block_4 = CodeBlock { Point.ByCoordinates(0,0,5); }
ZAxis = Vector.ZAxis()
# note: Create a plane going through the solid to cut with
byOriginNormal = Plane.ByOriginNormal(origin=code_block_4, normal=ZAxis)
# note: This point determins which part of the solid to trim
code_block_5 = CodeBlock { Point.ByCoordinates(10,10,10); }

# group: Loft -
# note: Geometric Boolean operations (Intersect, Difference, Union, Etc) are available in the Geometry Category.
trim = Geometry.Trim(geometry=translate_2, other=byOriginNormal, pick=code_block_5)
