# Dynamo graph ImportExport_CSV to Stuff.dyn (Dynamo 2.13.0.3265)
# author: Dynamo Team
# Dynamo Import Export Sample

# note: Browse a CSV file that has numbers
# in x, y, and z coordinate space
file_path = Filename("..\..\Data\helix.csv")
fromPath = FileObject(path=file_path)  # "File.FromPath"
readText = FileSystem.ReadText(file=fromPath)
string = StringInput("\n")
# note: Split the String on
# A carriage return <enter>
split = String.Split(string=readText, separator0=string)
string_2 = StringInput(",")
# note: Split the String on Comma
split_2 = String.Split(string=split, separator0=string_2)
# note: CSV files supply Strings, not numbers
toNumber = String.ToNumber(string=split_2)
# note: Group X, Y, & Z components
transpose = List.Transpose(lists=toNumber)
firstItem = List.FirstItem(list=transpose)
code_block = CodeBlock { 1; }
getItemAtIndex = List.GetItemAtIndex(list=transpose, index=code_block)
lastItem = List.LastItem(list=transpose)
byCoordinates = Point.ByCoordinates(x=firstItem, y=getItemAtIndex, z=lastItem)
number_slider = DoubleSlider(2.337, range=0..20 step 0.1)
# note: Adjust the overall distribution
# of the coordinate points
scale = Geometry.Scale(geometry=byCoordinates, amount=number_slider, lacing=Longest)
