# Dynamo graph ImportExport_Excel to Dynamo.dyn (Dynamo 2.13.0.3265)
# author: Dynamo Team
# Dynamo Import Export Sample

file_path = Filename("..\..\Data\helix.xlsx")
fromPath = FileObject(path=file_path)  # "File.FromPath"
string = StringInput("helix")
importExcel = Data.ImportExcel(file=fromPath, sheetName=string)
transpose = List.Transpose(lists=importExcel)
number = DoubleInput(0)
getItemAtIndex = List.GetItemAtIndex(list=transpose, index=number)
number_2 = DoubleInput(1)
getItemAtIndex_2 = List.GetItemAtIndex(list=transpose, index=number_2)
number_3 = DoubleInput(2)
getItemAtIndex_3 = List.GetItemAtIndex(list=transpose, index=number_3)
byCoordinates = Point.ByCoordinates(x=getItemAtIndex, y=getItemAtIndex_2, z=getItemAtIndex_3, lacing=Longest)
