# Dynamo graph OpenXMLExport_Data To Excel.dyn (Dynamo 3.0.3.7594)
# author: Dynamo Team
# A Dynamo sample graph showing how to export data to Excel.

# group: Initial inputs
# note: Drives the number of points. Think of it as the 'height' of the helix.
number_slider = DoubleSlider(1.7, range=0..5 step 0.1)

# group: Create the helix
# note: Create a series of numbers, starting from 0. The increment is 10. The number of points is multiplied by 360, so if the 'numCircles' input is 1 - the result is 37 numbers (0 to 360) and we will get a full revolution of the helix.
code_block = CodeBlock(numCircles=number_slider) { 0..(360*numCircles)..10; }
# note: cosine function
cos = Math.Cos(angle=code_block, lacing=Longest)
# note: sine function
sin = Math.Sin(angle=code_block, lacing=Longest)
# note: divide by 100
code_block_2 = CodeBlock(x=code_block) { x/100; }
# note: Create a list of points, the X component is the Cosine, the Y - the Sine, and the Z is the initial value divided by 100.
byCoordinates = Point.ByCoordinates(x=cos, y=sin, z=code_block_2, lacing=Longest)
# note: Create a list structure from the list of points - the result is a list containing 3 lists ([][] - dobule array), each containing the X, Y and Z point coordinate respectively.
code_block_3 = CodeBlock(pt=byCoordinates) { [pt.X,pt.Y,pt.Z]; }

# group: Create the inputs for the export
# 1. The file path to the csv file.
# 2. The name of the worksheet.
# 3. The transposed list of points.
# 4. The starting index for the row and column in Excel.
# note: The file path to the xlsx file.
file_path = Filename("..\..\Data\icosohedron_points.xlsx")
# note: The name of the Worksheet in excel.
string = StringInput("helix")
# note: Flip the mastrix (transpose the list). Columns will become row, and rows - columns.
transpose = List.Transpose(lists=code_block_3)
# note: The number of column/row to start recording the data in Excel
number = DoubleInput(0)

# group: Export data to Excel file
# note: Exports data to Excel
openXMLExportExcel = Data.OpenXMLExportExcel(filePath=file_path, sheetName=string, data=transpose, startRow=number, startColumn=number)
