# Dynamo graph OpenXMLImport_Data From Excel.dyn (Dynamo 2.13.0.3265)
# author: Dynamo Team
# Dynamo Import Export Sample

file_path = Filename("..\..\Data\helix.xlsx")
string = StringInput("helix")
openXMLImportExcel = Data.OpenXMLImportExcel(filePath=file_path, sheetName=string)
transpose = List.Transpose(lists=openXMLImportExcel)
number = DoubleInput(0)
getItemAtIndex = List.GetItemAtIndex(list=transpose, index=number)
number_2 = DoubleInput(1)
getItemAtIndex_2 = List.GetItemAtIndex(list=transpose, index=number_2)
number_3 = DoubleInput(2)
getItemAtIndex_3 = List.GetItemAtIndex(list=transpose, index=number_3)
byCoordinates = Point.ByCoordinates(x=getItemAtIndex, y=getItemAtIndex_2, z=getItemAtIndex_3, lacing=Longest)
