# Dynamo graph Revit_Color.dyn (Dynamo 2.19.0.6156)
# author: Dynamo Team
# This graph evaluates the surface area of selected elements and applies Graphic Overrides to color the elements based on that value.

# group: Info
# note: Run this graph the Snowdon Towers Sample Architectural.rvt file in the Samples folder located with your Revit installation
# C:\Program Files\Autodesk\Revit 2025\Samples
# note: This graph colors Revit Elements based on a measurable criteria (Surface Area).
# Elements are colored using the Override Graphics in View > By Element method.

# group: Select Model elements
# Select facade walls
# note: Click 'Change' to choose elements from the Revit model
select_model_elements = DSModelElementsSelection()  # 33 picked in the model; graph input

# group: Evaluate element surface area
# note: Get element's geometry
getGeometry = Element.GetGeometry(element=select_model_elements)
flatten = List.Flatten(list=getGeometry)
# note: Extract Surface Area of Geometry
area = Solid.Area(solid=flatten)
# note: Get highest value
maximumItem = List.MaximumItem(list=area)
# note: Normalize at highest value
div = area / maximumItem  # graph output

# group: Create colors
# Prepare the color scheme to color-code the elements
number = DoubleInput(0)
number_2 = DoubleInput(255)
# note: color green
byARGB = Color.ByARGB(alpha=number, red=number, green=number_2, blue=number, lacing=Longest)
number_3 = DoubleInput(0)
number_4 = DoubleInput(255)
# note: color red
byARGB_2 = Color.ByARGB(alpha=number_3, red=number_4, green=number_3, blue=number_3, lacing=Longest)
create = List.Create(item0=byARGB, item1=byARGB_2)
code_block = CodeBlock { [0,1]; }
# note: set color range
color_range = ColorRange(colors=create, indices=code_block, value=div)

# group: To Revit: Override Element Color in View
# note: This overrides the color of the element in the active view
overrideColorInView = Element.OverrideColorInView(element=select_model_elements, color=color_range, lacing=Longest)

# group: Threshold
number_5 = DoubleInput(100)

# group: Alternative - evaluate if criteria passes a given threshold
# note: Compare with a threshold value
gt = area > number_5
# note: Numbers will indicate the position on the color spectrum - from 0 to 1
number_6 = DoubleInput(1)
number_7 = DoubleInput(0)
# note: identify areas within a tolerance
if_ = RefactoredIf(test=gt, true=number_6, false=number_7)
# note: this result can be used as 'indices' input of the Color Range node
watch = Watch(if_)
