# Dynamo graph Revit_GeometryCreation_Curves.dyn (Dynamo 2.19.0.6156)
# author: Dynamo Team
# This graph showcases several methods of creating Curves in Dynamo and using them to create Revit elements (Model Lines)

# group: Info
# note: This graph uses several methods of creating curves to be used as input for creating Revit Model Curves
# note: Run this graph the Snowdon Towers Sample Architectural.rvt file in the Samples folder located with your Revit installation
# C:\Program Files\Autodesk\Revit 2025\Samples

# group: Four Points
number = DoubleInput(-35)
number_2 = DoubleInput(-55)
byCoordinates = Point.ByCoordinates(x=number, y=number_2)
number_3 = DoubleInput(-40)
byCoordinates_2 = Point.ByCoordinates(x=number, y=number_3)
number_4 = DoubleInput(-10)
byCoordinates_3 = Point.ByCoordinates(x=number_4, y=number_3)
number_5 = DoubleInput(-17)
number_6 = DoubleInput(-60)
byCoordinates_4 = Point.ByCoordinates(x=number_5, y=number_6)

list_create = List.Create(item0=byCoordinates, item1=byCoordinates_2, item2=byCoordinates_3, item3=byCoordinates_4)

# group: Create Model curve from Nurbs Curve (by Points)
# note: Create a NURBS curve from a list of points
byPoints = NurbsCurve.ByPoints(points=list_create)
# note: Use the NURBS curve to create a Revit Model Line
byCurve = ModelCurve.ByCurve(curve=byPoints)

# group: Create Model curve from Nurbs Curve (by Control Points)
boolean = BoolSelector(false)
# note: Create a NURBS curve from a list of points as Control Points
byControlPoints = NurbsCurve.ByControlPoints(points=list_create, closeCurve=boolean)
# note: Use the NURBS curve to create a Revit Model Line
byCurve_2 = ModelCurve.ByCurve(curve=byControlPoints)

# group: Create Model curve from Polycurve
# note: Create a Polycurve from a list of points
byPoints_2 = PolyCurve.ByPoints(points=list_create)
curves = PolyCurve.Curves(polyCurve=byPoints_2)
# note: Use the list of curves to create a set of Revit Model Line
byCurve_3 = ModelCurve.ByCurve(curve=curves)

# group: Create Model curve from Line
# note: Create a curve from two points
byStartPointEndPoint = Line.ByStartPointEndPoint(startPoint=byCoordinates, endPoint=byCoordinates_2)
# note: Use the Line (Curve) to create a Revit Model Curve
byCurve_4 = ModelCurve.ByCurve(curve=byStartPointEndPoint)
