# Dynamo graph Revit_GeometryCreation_Points_and_Curves.dyn "Basics_Basic02" (Dynamo 2.0.1.4357)

byCoordinates = Point.ByCoordinates()
# note: Geometric Data can be visualized as either textual information or in 3d space
watch = Watch(byCoordinates)
# note: You can toggle between 3d navigation and node navigation with the Geom/Node Butttons in the lower right of the screen.  Background Preview can also be turned on and off in the View Menu
number = DoubleInput(2)  # graph input
number_slider = DoubleSlider(4.43, range=0..10 step 0.1)  # graph input
byCoordinates_2 = Point.ByCoordinates(x=number, z=number_slider)
byStartPointEndPoint = Line.ByStartPointEndPoint(startPoint=byCoordinates_2, endPoint=byCoordinates)
watch_3d = Watch3D(byStartPointEndPoint)
byCurve = ModelCurve.ByCurve(curve=byStartPointEndPoint)
# note: Dynamo interacts with Revit with special Revit nodes.
# Dynamo can only create and modify elements that are appropriate to the file that Dynamo is associated with.  For instance, Reference Points can only be made in certain Family environments, while Model Lines can be created almost anywhere. Pass any curve element to Revit Elements that are driven by Lines or other Curves to create them.
byPoint = ReferencePoint.ByPoint(pt=byCoordinates_2)
