# Dynamo graph Revit_GeometryCreation_Solids.dyn (Dynamo 2.19.3.6543)
# author: Dynamo Team
# This graph presents several methods of creating Solid geometry in Dynamo and integrating it in Revit - some methods may be used in a project environment, others - only in certain Family environments (Conceptual Mass).

# group: Info
# note: Multiple creation methods exist for most Solids.  These examples show Closed Profiles as the base, but polysurfaces can be stitched, many primitives are available (Surfaces, Cuboid, Cone, etc).
# In order to integrate geometry into the Revit environment, it first needs to be converted into a Revit Element.
# Solids can be transformed into an Import Instance that will be visible both Project and model Family environments.
# The Solid geometry can also be converted into a Form element that is only available for Conceptual Mass and Adaptive Component Family environments.
# note: This graph uses several methods to create Solid geometry in Revit - some methods can be used in a Project environment, others - only in certain Family environments.
# Use a Conceptual Mass family template to view all methods.
# To open a Conceptual Mass family by going to File > New > Family > and select the Mass.rft template\Conceptual Mass\Mass.rft

# group: Prepare Points
# Generate a set of points to build geometry
byCoordinates = Point.ByCoordinates()
number = DoubleInput(10)
byCoordinates_2 = Point.ByCoordinates(x=number)
number_2 = DoubleInput(5)
byCoordinates_3 = Point.ByCoordinates(z=number_2)
number_3 = DoubleInput(10)
byCoordinates_4 = Point.ByCoordinates(y=number_3)
number_4 = DoubleInput(15)
byCoordinates_5 = Point.ByCoordinates(x=number_4, y=number_4)
number_5 = DoubleInput(5)
number_6 = DoubleInput(10)
byCoordinates_6 = Point.ByCoordinates(x=number_5, y=number_6, z=number_6)
number_7 = DoubleInput(-2)
number_8 = DoubleInput(5)
byCoordinates_7 = Point.ByCoordinates(x=number_7, y=number_8)

# group: First Profile
# Create a first profile as a closed curve from an Arc and a Line
byStartPointEndPoint = Line.ByStartPointEndPoint(startPoint=byCoordinates, endPoint=byCoordinates_2)
byThreePoints = Arc.ByThreePoints(firstPoint=byCoordinates, secondPoint=byCoordinates_3, thirdPoint=byCoordinates_2)
create = List.Create(item0=byStartPointEndPoint, item1=byThreePoints)
# note: First Profile for the Loft
byJoinedCurves = PolyCurve.ByJoinedCurves(curves=create)

# group: Second Profile
# Create a second profile as a closed curve from an Arc and a Line
byStartPointEndPoint_2 = Line.ByStartPointEndPoint(startPoint=byCoordinates_4, endPoint=byCoordinates_5)
byThreePoints_2 = Arc.ByThreePoints(firstPoint=byCoordinates_4, secondPoint=byCoordinates_6, thirdPoint=byCoordinates_5)
create_2 = List.Create(item0=byStartPointEndPoint_2, item1=byThreePoints_2)
# note: Second Profile for the Loft
byJoinedCurves_2 = PolyCurve.ByJoinedCurves(curves=create_2)

# note: Join two profiles in a list
create_3 = List.Create(item0=byJoinedCurves, item1=byJoinedCurves_2)

# group: Solid Loft by Cross Sections
byLoft = Solid.ByLoft(crossSections=create_3)

# note: Investigate the volume of the solid
volume = Solid.Volume(solid=byLoft)

# group: Create Shell
code_block = CodeBlock { 0; }
# note: Tip:  Turn off "Preview" in Node Right Click menus to exclude elements from Showing
thinShell = Solid.ThinShell(solid=byLoft, internalFaceThickness=code_block)

# group: Translate geometry
code_block_2 = CodeBlock { Vector.ByCoordinates(20,0,0); }
# note: Translate the geometry to the side to preview both the original and the final result
translate = Geometry.Translate(geometry=thinShell, direction=code_block_2)

# group: Trim Solid
# Use Trim operation to cut the shell solid with a Plane.
code_block_3 = CodeBlock { Point.ByCoordinates(0,0,5); }
ZAxis = Vector.ZAxis()
byOriginNormal = Plane.ByOriginNormal(origin=code_block_3, normal=ZAxis)
number_9 = DoubleInput(10)
# note: Choose which side of the trim to keep (the side closest to the point will be discarded).
byCoordinates_8 = Point.ByCoordinates(x=number_9, y=number_9, z=number_9)
# note: Geometric Boolean operations (Intersect, Difference, Union, Etc) are available in the Geometry Category.
trim = Geometry.Trim(geometry=translate, other=byOriginNormal, pick=byCoordinates_8)

# group: Guide Curve
# Create a NURBS curve to be used as a guide curve for the Loft Solid shape
create_4 = List.Create(item0=byCoordinates, item1=byCoordinates_7, item2=byCoordinates_4)
# note: Guide Curve constructed as a NURBS curve
byPoints = NurbsCurve.ByPoints(points=create_4)

# group: Solid Loft by Cross Sections and Guide Curves
# note: Tip:  Turn off "Preview" in Node Right Click menus to exclude elements from Showing
byLoft_2 = Solid.ByLoft(crossSections=create_3, guideCurves=byPoints)

# group: Create Import Instance
code_block_4 = CodeBlock { Vector.ByCoordinates(-20,0,0); }
translate_2 = Geometry.Translate(geometry=byLoft_2, direction=code_block_4)
# note: Geometry is not the same as a Revit Element:
# Use ImportInstance To create Revit Imports from Surfaces and Solids in any Revit Environment, use Points and Curves to place Family Instances, or create Form in Mass and Generic Model By Point (Adaptive Component) Families
byGeometries = ImportInstance.ByGeometries(geometries=translate_2)
byCoordinates_9 = Vector.ByCoordinates()

# group: Create Form
# Using two profile curve loops, create a Form element (in Conceptual Mass family environment)
curves = PolyCurve.Curves(polyCurve=create_3)
# note: Create Model Curves from curves
referenceCurveByCurve = ModelCurve.ReferenceCurveByCurve(curve=curves)
# note: Forms can only be created as part of a Conceptual Mass Family
byLoftCrossSections = Form.ByLoftCrossSections(curves=referenceCurveByCurve)

number_10 = DoubleInput(0)
