# Dynamo graph Revit_PlaceFamiliesByLevel_Set Parameters.dyn (Dynamo 0.8.0.760)

# note: Run this graph the DynamoSample.rvt file in the Samples folder located with your Dynamo installation
# C:\ProgramData\Dynamo\Dynamo Revit\(Your Dynamo Version)\samples\Revit
# note: Place a number of Solar panels and write unique numbers to their Mark Parameter
family_types = FamilyTypes("Photovoltaic-Panel-SolarWorld-SunModule-(235-240):SunModule SW 245 Silver Mono - 10 Deg. Angle")
code_block = CodeBlock { -10; 10; 2.5; }
number_range = NumberRange(code_block.out0, code_block.out1, code_block.out2, lacing=Longest)
code_block_2 = CodeBlock { -10..-15..#3; }
byCoordinates = Point.ByCoordinates(x=number_range, y=code_block_2, lacing=CrossProduct)
flatten = Flatten(byCoordinates)
levels = Levels("Level 1 Living Rm.")
# note: Place Family Instances
# Most Families Can also be placed by Point location.  Adaptive Components can be placed with multiple points, Structural Framing is placed with Curves
byPointAndLevel = FamilyInstance.ByPointAndLevel(family_types, flatten, levels)
string = StringInput("Mark")
number = DoubleInput(1)
count = Count(byPointAndLevel)
number_sequence = NumberSeq(number, count, number, lacing=Longest)
string_from_object = FromObject(number_sequence)
# note: Set each Family instance parameter.  Using the same model, parameters can also be read, using an Element.GetParameterByName
setParameterByName = Element.SetParameterByName(element=byPointAndLevel, parameterName=string, value=string_from_object)
