# Dynamo graph Revit_StructuralFraming.dyn (Dynamo 2.1.0.7455)

# note: Run this graph the DynamoSample.rvt file in the Samples folder located with your Dynamo installation
# C:\ProgramData\Dynamo\Dynamo Revit\(Your Dynamo Version)\samples\Revit
# note: Place Structural Framing Relative to some elements selected from a Revit file
select_model_element = DSModelElementSelection()  # 1 picked in the model
geometry = Element.Geometry(element=select_model_element)
integer_slider = IntegerSlider(9, range=2..10 step 1)
code_block = CodeBlock(x=integer_slider) { 0..1..#x; }
pointAtParameter = Curve.PointAtParameter(curve=geometry, param=code_block, lacing=CrossProduct)
# note: Model Curves have been selected and their element IDs saved with this file
select_model_element_2 = DSModelElementSelection()  # 1 picked in the model
# note: Geometry is Seperated from Revit Elements
geometry_2 = Element.Geometry(element=select_model_element_2)
# note: Create Points along the Lines
pointAtParameter_2 = Curve.PointAtParameter(curve=geometry_2, param=code_block, lacing=CrossProduct)
byStartPointEndPoint = Line.ByStartPointEndPoint(startPoint=pointAtParameter, endPoint=pointAtParameter_2)
flatten = List.Flatten(list=byStartPointEndPoint)
levels = Levels("Ceiling")
structural_framing_types = StructuralFramingTypes("1 3/4x14")
# note: Place Structural Framing
beamByCurve = StructuralFraming.BeamByCurve(curve=flatten, level=levels, structuralFramingType=structural_framing_types)
