# Dynamo graph Basics_Basic01.dyn (Dynamo 2.19.3.6543)
# author: Dynamo Team
# Conectar nodos para sumar dos números

# note: Las entradas funcionales básicas como números y cadenas se pueden seleccionar navegando o buscando en la biblioteca a la izquierda del lienzo.
# Las operaciones que se ejecutan en datos, por ejemplo transformaciones matemáticas o geométricas, también están en la biblioteca.
# note: Dynamo es un lenguaje de programación visual. Al igual que otros lenguajes, funciona vinculando entre sí elementos sencillos para configurar conceptos más complejos.
# note: Extraiga un conector del puerto ">" del nodo Number y conéctelo al puerto "y" en el nodo +; a continuación, haga clic en el botón "Ejecutar" en la esquina inferior izquierda de la aplicación.
number = DoubleInput(2)  # graph input
add = number + _  # unwired: y
# note: Se pueden visualizar los datos. Para ello, haga clic en el botón Ejecutar en la esquina inferior izquierda de la aplicación. Si activa el modo de ejecución "Automático", la aplicación se actualizará constantemente.
# Puede ver los datos mediante un nodo Watch o haciendo clic en el pequeño cuadrado que aparece en la parte inferior de la mayoría de los nodos.
watch = Watch(add)
# note: En el menú Ayuda, puede encontrar más archivos de muestra. Cierre este archivo haciendo clic en la "X" de la ficha para volver a la página de bienvenida.
number_2 = DoubleInput(6)  # graph input
