# Dynamo graph Basics_Basic02.dyn (Dynamo 2.19.3.6543)
# author: Dynamo Team
# Crear una línea mediante la conexión de dos puntos

# note: Manipule la posición del punto en el entorno de Dynamo: seleccione el nodo Point.ByCoordinates y cambie a la vista preliminar en segundo plano para tirar del punto a lo largo de sus tres ejes.
byCoordinates = Point.ByCoordinates()
# note: Los datos geométricos se pueden visualizar como información textual o en un espacio 3D.
watch = Watch(byCoordinates)
number = DoubleInput(2)  # graph input
# note: Utilice los nodos Number Slider o Integer Slider para introducir de forma dinámica un valor dentro de un rango especificado. Haga clic en la flecha azul desplegable para abrir la configuración del rango numérico.
number_slider = DoubleSlider(4.43, range=0..10 step 0.1)  # graph input
# note: Puede alternar entre la navegación 3D en segundo plano y en una vista gráfica con los botones situados en la esquina superior derecha de la pantalla (método abreviado Ctrl + B). La vista preliminar en segundo plano también puede activarse y desactivarse en el menú Vista de Dynamo y Revit.
byCoordinates_2 = Point.ByCoordinates(x=number, z=number_slider)
byStartPointEndPoint = Line.ByStartPointEndPoint(startPoint=byCoordinates_2, endPoint=byCoordinates)
# note: Utilizar el nodo Watch 3D para visualizar el elemento 3D de forma aislada
watch_3d = Watch3D(byStartPointEndPoint)
