# Dynamo graph Basics_Basic03.dyn (Dynamo 2.19.3.6543)
# author: Dynamo Team
# Cree una lista sencilla.

# group: Entradas
# note: Se pueden generar listas de datos con secuencias y rangos. Estas listas pueden reorganizarse con muchos otros nodos para fines específicos.
number = DoubleInput(0)  # graph input
number_2 = DoubleInput(9)  # graph input
number_3 = DoubleInput(1)  # graph input

# note: Crea una secuencia de números, comenzando desde el "Start" hasta "End" con un valor de "Step" especificado.
range = Range(start=number, end=number_2, step=number_3, lacing=Longest)
watch = Watch(range)
number_4 = DoubleInput(3)  # graph input
# note: Segmentar la lista en una longitud de 3
chop = List.Chop(list=range, lengths=number_4)
# note: Previsualizar el resultado y observar la estructura de la lista con la ayuda de un nodo Watch
watch_2 = Watch(chop)
# note: Obtener el último elemento de una lista
lastItem = List.LastItem(list=range)
watch_3 = Watch(lastItem)
