# Dynamo graph Core_AttractorPoint.dyn (Dynamo 3.0.0.6964)
# author: Dynamo Team
# Este gráfico crea una rejilla de cilindros, cuyos tamaños vienen determinados por la posición de un punto de atractor.

# group: Información
# note: PUNTO DE ATRACTOR
# Un punto de atractor es un punto de referencia (o elemento) que influye en las características de otros elementos de un sistema. Con frecuencia, ese punto de atractor funciona como un imán; cuanto más cerca esté el elemento del atractor, más se verá afectado por la influencia de este.
# En este ejemplo, la altura y el diámetro de los cilindros vienen determinados por la distancia entre cada cilindro y el punto de atractor que se desplaza a su alrededor. Los cilindros en torno al punto de atractor son más pequeños que los más alejados.
# Para visualizar este comportamiento, mueva los dos controles deslizantes de número de la entrada del punto de atractor.
# Los puntos de atractor permiten incorporar un nivel de capacidad de respuesta y comportamiento dinámico al proceso de diseño.

# group: Tamaño de rejilla de puntos
# note: Usar un Code Block para crear una secuencia de números. En este caso, se crea una secuencia con números del 1 al 50, con n pasos, donde cada paso es de 5.
rango_de_números = CodeBlock { 1..50..5; }

# group: Crear una rejilla de puntos
# note: Rejilla de puntos.
# Para ello, transfiera una serie de números a dos puertos: las coordenadas X e Y. Haga clic con el botón derecho en el nodo y cambie el Encaje a Producto cartersiano.
# note: El encaje de producto cartesiano de un nodo combina cada elemento de una lista con cada elemento de todas las demás listas, lo que da como resultado una estructura de listas en forma de rejilla.
# Si se utiliza con las entradas X e Y del nodo"'Point.ByCoordinates", el resultado es una rejilla plana de puntos. Si se utiliza la tercera coordenada, Z, el resultado es una rejilla de puntos en forma de cubo.
byCoordinates = Point.ByCoordinates(x=rango_de_números, y=rango_de_números, lacing=CrossProduct)

# group: Aplanar estructura de listas
# No se requiere una estructura de lista compleja para las acciones adicionales con los puntos. Aplane para generar solo una lista.
# note: Aplanar la lista porque la jerarquía de filas y columnas no es necesaria. Comparar la entrada a este nodo con la salida; la estructura de N listas se transforma en una sola lista.
flatten = List.Flatten(list=byCoordinates)

# group: Posición del punto de atractor
number_slider = DoubleSlider(24.6, range=-10..60 step 0.1)  # graph input
number_slider_2 = DoubleSlider(11.50111001, range=-10..60 step 0.1)  # graph input
# note: Punto de atractor. Deslice los controles deslizantes de entrada para ajustar la ubicación de este punto.
byCoordinates_2 = Point.ByCoordinates(x=number_slider, y=number_slider_2)

# group: Distancia al atractor
# note: Busca la distancia entre el punto de atractor y cada punto base de los cilindros
distanceTo = Geometry.DistanceTo(geometry=flatten, other=byCoordinates_2)

# group: Generar radios y alturas
# note: Fórmula para que la altura de los cilindros reaccione a la ubicación del punto de atractor.  En este ejemplo, la altura de cada cilindro es la mitad de la distancia al punto de atractor. Pruebe con otra fórmula.
altura_del_cilindro = CodeBlock(x=distanceTo) { x/2; }
# note: Una fórmula devuelve un valor que se utilizará como radio del cilindro. Cuanto mayor sea la distancia, mayor será el radio de cada cilindro. Pruebe a utilizar una fórmula diferente.
radio_del_cilindro = CodeBlock(x=distanceTo) { x/15; }

# group: Puntos finales
# Traslade el punto inicial (original) de cada cilindro con una altura especificada, definida por la fórmula.
# note: Vector para mover el punto base (original) hacia arriba según un valor especificado
byCoordinates_3 = Vector.ByCoordinates(z=altura_del_cilindro)
# note: Añadir este nuevo valor Z (altura) a los puntos de la rejilla original para obtener los puntos superiores de los cilindros
add = Point.Add(point=flatten, vectorToAdd=byCoordinates_3)

# group: Crear cilindros
# note: Utilizar un método que cree un cilindro con un punto inicial y final y un radio especificados
byPointsRadius = Cylinder.ByPointsRadius(startPoint=flatten, endPoint=add, radius=radio_del_cilindro)
