# Dynamo graph Core_CodeBlocks.dyn (Dynamo 3.4.1.7055)
# author: Dynamo Team
# Este gráfico explora varios usos y aplicaciones de los bloques de código.

# group: Información
# note: BLOQUES DE CÓDIGO
# Los bloques de código pueden crearse haciendo doble clic en el lienzo. También puede encontrar un bloque de código en la biblioteca de nodos, en la categoría Script > Editor.
# Los bloques de código pueden contener lo siguiente:
# •   Valores numéricos (números enteros y de punto flotante)
# •  Cadenas (texto)
# •  Valores booleanos ("True", verdadero, o "False", falso)
# •  Listas  [0,1,2]
# •  Expresiones (a+3)
# •  Variables
# Otros nodos pueden transformarse en una expresión de bloque de código; seleccione uno o varios nodos y haga clic con el botón derecho en el espacio entre los nodos para seleccionar "Nodo para código". No existe un equivalente inverso a esta acción; los bloques de código no pueden transformarse automáticamente en nodos.

# group: Nodos como bloques de código
# note: Los bloques de código pueden utilizarse para llamar a cualquier otro nodo de la biblioteca. Los nodos de la biblioteca suelen ser de tres tipos:
#     Crear:		crear algo
#     Acción:	realizar una acción en algo
#     Consulta:	obtener una propiedad de algo
# 		que ya existe
# Los métodos (o nodos) de estos tres tipos se tratan de forma diferente cuando se llama a ellos dentro de un bloque de código.

# group: Creación de geometría
# note: Juntas, estas sentencias forman un algoritmo que crea una curva helicoidal en un punto base.
code_block = CodeBlock()
# ---------- code_block.designscript (16 lines) ----------
// Basic inputs
base = Point.ByCoordinates(3,3);
coils = 3;
height = 5;
rad = 0.5;

// Make a series of points
numPts = 8*coils + 1;
seq = 0..(coils*360)..#numPts;
x = rad * Math.Cos(seq);
y = rad * Math.Sin(seq);
z = 0..height..#numPts;
pts = Point.ByCoordinates(x + base.X, y + base.Y, z + base.Z);

// Pass a curve through those points
NurbsCurve.ByPoints(pts);
# ----------------------------------------
# note: El algoritmo helicoidal se transforma en una función asignándole un nombre, especificando las entradas e indicándole lo que debe retornar.
code_block_2 = CodeBlock()
# ---------- code_block_2.designscript (13 lines) ----------
def MakeSpring(base,coils,height,rad)
{
// Make a series of points
numPts = 8*coils + 1;
seq = 0..(coils*360)..#numPts;
x = rad * Math.Cos(seq);
y = rad * Math.Sin(seq);
z = 0..height..#numPts;
pts = Point.ByCoordinates(x + base.X, y + base.Y, z + base.Z);

// Return the curve that passes through those points
return = NurbsCurve.ByPoints(pts);
};
# ----------------------------------------
code_block_3 = CodeBlock { 0..6..2; }
code_block_4 = CodeBlock { 10..20..2; }
# note: El algoritmo helicoidal se transforma para definir una función con el nombre arbitrario "MakeSpring". Esta función se invoca para crear varios muelles, con alturas aleatorias, organizados en una rejilla.
# note: Crea una rejilla.
byCoordinates = Point.ByCoordinates(x=code_block_3, y=code_block_4, lacing=CrossProduct)
flatten = List.Flatten(list=byCoordinates)
code_block_5 = CodeBlock { 5; }
count = List.Count(list=flatten)
# note: Realiza una serie de números aleatorios (de 5 en 5) para las alturas de muelle.
randomList = Math.RandomList(amount=count)
code_block_6 = CodeBlock(random=randomList) { random * 5; }
# note: Las entradas de las llamadas de función se pueden efectuar con listas de cosas o elementos de un solo valor. Los datos se pueden pasar través de un puerto o declararse directamente, como en el caso de "0,5" para el radio de todos los muelles.
code_block_7 = CodeBlock(basePoints=flatten, numCoils=code_block_5, height=code_block_6) { MakeSpring(basePoints,numCoils,height,0.5); }

# group: Funciones
# note: Las funciones se pueden definir directamente en un nodo de bloque de código al que se invoca desde cualquier parte de esta definición.
# La primera línea tiene la palabra clave "def", luego el nombre de función y después las entradas entre paréntesis.
# Las llaves definen el cuerpo de la función. Cada línea debe terminar en punto y coma.
# Se devuelve un valor con "return = ".
code_block_8 = CodeBlock()
# ---------- code_block_8.designscript (11 lines) ----------
/* This is a multi-line comment,
     which continues for mulitple
     lines. */

def FunctionName(input1, input2)
{
// This is a comment
sum = input1 + input2;

return = sum;
};
# ----------------------------------------
code_block_9 = CodeBlock { 1; }
# note: Los nodos de bloque de código que definen una función no tienen puertos de entrada o salida porque se invocan desde otros nodos de bloque de código.
code_block_10 = CodeBlock { 2; }
# note: Invoque la función con otro nodo de bloque de código en el mismo archivo asignando el mismo nombre y la misma cantidad de argumentos.
code_block_11 = CodeBlock(in1=code_block_9, in2=code_block_10) { FunctionName(in1,in2); }
watch = Watch(code_block_11)
code_block_12 = CodeBlock { "cat"; }
code_block_13 = CodeBlock { "dog"; }
# note: El tipo de argumentos de entrada no se especifica en la definición de función, por lo tanto operará en cualquier cosa que reciba.
code_block_14 = CodeBlock(in1=code_block_12, in2=code_block_13) { FunctionName(in1,in2); }
watch_2 = Watch(code_block_14)
origin = Point.Origin()
code_block_15 = CodeBlock { 16; }
# note: Una invocación de función con entradas que no tengan sentido en dicha función darán un resultado nulo.
code_block_16 = CodeBlock(in1=origin, in2=code_block_15) { FunctionName(in1,in2); }
watch_3 = Watch(code_block_16)

# group: Valores numéricos
# Compare los nodos creados específicamente con un bloque de código.
# note: Creado específicamente
number = DoubleInput(3.14)
resultado = Watch(number)
# note: Bloque de código
code_block_17 = CodeBlock { 3.140; }
watch_4 = Watch(code_block_17)

# group: Valores de cadena
# Compare los nodos creados específicamente con un bloque de código.
# note: Creado específicamente
string = StringInput("Less is more.")
resultado_2 = Watch(string)
# note: Usar comillas ("") para crear una cadena con un nodo de bloque de código
code_block_18 = CodeBlock { "Less is more."; }
watch_5 = Watch(code_block_18)
# note: Utilizar este nodo para ver el tipo de valor de salida
type = Object.Type(object=code_block_18)
watch_6 = Watch(type)

# group: Expresiones
# Realice una operación de multiplicación mediante un nodo * creado específicamente y un bloque de código.
number_2 = DoubleInput(3)
number_3 = DoubleInput(5)
# note: Multiplicar dos números mediante el nodo *
mul = number_2 * number_3
resultado_3 = Watch(mul)
# note: Realizar una multiplicación mediante un bloque de código
code_block_19 = CodeBlock { 3*5; }
watch_7 = Watch(code_block_19)
code_block_20 = CodeBlock { 3; }
code_block_21 = CodeBlock { 5; }
# note: Utilizar variables como entradas para la operación de multiplicación
code_block_22 = CodeBlock(a=code_block_20, b=code_block_21) { a*b; }
watch_8 = Watch(code_block_22)

# group: Consultar
# Métodos que consultan y devuelven una propiedad de un objeto.
# note: Los bloques de código proporcionan al usuario la flexibilidad de decidir cómo especificar entradas. Aquí hay modos diferentes, por ejemplo, de crear el mismo punto.
code_block_23 = CodeBlock { 10; }
code_block_24 = CodeBlock { -10; }
# note: Método predefinido que utiliza el nodo Point.ByCoordinates
byCoordinates_2 = Point.ByCoordinates(x=code_block_23, y=code_block_24)
watch_9 = Watch(byCoordinates_2)
# note: El bloque de código utiliza un método Point.ByCoordinates con tres variables para X, Y y Z, donde Z se define dentro del mismo bloque de código y se separa con un símbolo de punto y coma ";".
code_block_25 = CodeBlock(x=code_block_23, y=code_block_24) { z = 0; Point.ByCoordinates(x,y,z); }
watch_10 = Watch(code_block_25.out1)
code_block_26 = CodeBlock { Point.ByCoordinates(10,0,0); }
# note: Un bloque de código equivalente al mismo método (los métodos de consulta no requieren paréntesis)
code_block_27 = CodeBlock(pt=code_block_26) { pt.X; }
watch_11 = Watch(code_block_27)
# note: Método de consulta predefinido que devuelve la coordenada X del punto
X = Point.X(point=code_block_26)
watch_12 = Watch(X)
# note: Una fórmula de uso de un valor negativo del mismo valor numérico aquí se integra en la notación para las variables de entrada
code_block_28 = CodeBlock(num=code_block_23) { Point.ByCoordinates(num,-num,0); }
watch_13 = Watch(code_block_28)
# note: El bloque de código utiliza un método Point.ByCoordinates con las tres variables especificadas como entrada
code_block_29 = CodeBlock { Point.ByCoordinates(10,-10,0); }
watch_14 = Watch(code_block_29)

# group: Crear
# Métodos que crean geometría, listas, elementos de Revit u otros objetos.
# note: Método predefinido de creación de un punto en el origen
origin_2 = Point.Origin()
watch_15 = Watch(origin_2)
# note: Aunque este método no necesita entradas, se requieren paréntesis.
code_block_30 = CodeBlock { Point.Origin(); }
watch_16 = Watch(code_block_30)
code_block_31 = CodeBlock { 0; -10; }
# note: Método predefinido de creación de un punto mediante las coordenadas X e Y
byCoordinates_3 = Point.ByCoordinates(x=code_block_31.out0, y=code_block_31.out1)
watch_17 = Watch(byCoordinates_3)
# note: Utilice un Code Block para reproducir el comportamiento del nodo Point.ByCoordinates. Descubrirá el nombre del método si coloca el cursor sobre el nodo predefinido original; el método se indica en la parte inferior de la ventana de información de herramientas.
# Las entradas deben especificarse en el orden en que se encuentran en el nodo predefinido.
code_block_32 = CodeBlock { Point.ByCoordinates(0,-10); }
watch_18 = Watch(code_block_32)

# group: Acción
# Métodos que ejecutan una acción en un objeto.
origin_3 = Point.Origin()
ZAxis = Vector.ZAxis()
# note: Método predefinido de adición de un vector a un punto
add = Point.Add(point=origin_3, vectorToAdd=ZAxis)
watch_19 = Watch(add)
origin_4 = Point.Origin()
ZAxis_2 = Vector.ZAxis()
# note: Los métodos de acción se realizan en un objeto. Utilice la notación de puntos después del propio objeto y especifique el método y todas las entradas que se encuentran en el nodo predefinido, excepto la primera (ya que el primer puerto de entrada es el propio objeto del que ya dispone).
code_block_33 = CodeBlock(pt=origin_4, vector=ZAxis_2) { pt.Add(vector); }
watch_20 = Watch(code_block_33)

# group: Crear listas
# note: Crear una lista mediante corchetes para definir la lista y comas para separar los elementos individuales
code_block_34 = CodeBlock { ["San Francisco","New York","Chicago"]; }
watch_21 = Watch(code_block_34)
# note: Obtener elementos de una lista mediante la siguiente notación: list [ i ], donde i es el índice del elemento. Este método es idéntico al uso del nodo GetItemAtIndex.
code_block_35 = CodeBlock(cities=watch_21) { cities[2]; }
watch_22 = Watch(code_block_35)
# note: Multiple variables are defined in this code block, and at the end, a list is created containing all of them.
code_block_36 = CodeBlock()
# ---------- code_block_36.designscript (7 lines) ----------
str0 = "alpha";
str1 = "beta";
str2 = "charlie";
str3 = "delta";
str4 = "echo";
//
[str0,str1,str2,str3,str4];
# ----------------------------------------
watch_23 = Watch(code_block_36.out5)
code_block_37 = CodeBlock(phonetic=watch_23) { phonetic[2..3]; }
watch_24 = Watch(code_block_37)
code_block_38 = CodeBlock { 2; }
getItemAtIndex = List.GetItemAtIndex(list=watch_21, index=code_block_38)
watch_25 = Watch(getItemAtIndex)

# group: Combinar listas y elementos de listas de acceso
# Descripción <Haga doble clic aquí para editar la descripción del grupo>
# note: Crea listas anidadas y obtiene elementos de listas anidadas.
code_block_39 = CodeBlock()
# ---------- code_block_39.designscript (6 lines) ----------
kitchen = ["table","stove","sink","refrigerator"];
livingRoom = ["sofa","books"];
bedroom = ["bed","dirty clothes"];
bathroom = ["tooth brush"];
//
allMyStuff = [kitchen, livingRoom, bedroom, bathroom];
# ----------------------------------------
watch_26 = Watch(code_block_39.allMyStuff)
# note: Acceder al segundo elemento dentro de la tercera lista (o, en otras palabras, acceder al elemento con índice "1" dentro de la lista con índice "2")
code_block_40 = CodeBlock(list=watch_26) { list[2][1]; }
watch_27 = Watch(code_block_40)

# group: Replicación
# note: Las guías de replicación se pueden utilizar para especificar que las listas encajen como "producto cartesiano".
code_block_41 = CodeBlock { x_vals = 0..10; y_vals = -30..-40; }
code_block_42 = CodeBlock(x_vals=code_block_41.x_vals, y_vals=code_block_41.y_vals) { Point.ByCoordinates(x_vals, y_vals); }
code_block_43 = CodeBlock { x_vals = 0..10; y_vals = -15..-25; }
code_block_44 = CodeBlock(x_vals=code_block_43.x_vals, y_vals=code_block_43.y_vals) { Point.ByCoordinates(x_vals<1>, y_vals<2>); }
byCoordinates_4 = Point.ByCoordinates(x=code_block_41.x_vals, y=code_block_41.y_vals)
byCoordinates_5 = Point.ByCoordinates(x=code_block_43.x_vals, y=code_block_43.y_vals, lacing=CrossProduct)
# note: Las guías de replicación, que utilizan corchetes angulares, toman dos o tres colecciones unidimensionales, y emparejan los elementos para generar una colección unidimensional, bidimensional o tridimensional.
# note: En este ejemplo, hay 2 valores x y 5 valores y. Las guías de replicación pueden especificar que la combinación resultante sea 2 listas de 5 puntos o 5 listas de 2 puntos.
code_block_45 = CodeBlock()
# ---------- code_block_45.designscript (5 lines) ----------
x_vals = 0..1;
y_vals = -3..-7;
//
Point.ByCoordinates(x_vals<1>, y_vals<2>);
Point.ByCoordinates(x_vals<2>, y_vals<1>);
# ----------------------------------------
watch_28 = Watch(code_block_45.out2)
watch_29 = Watch(code_block_45.out3)

# group: Booleano
# Compare los nodos creados específicamente con un bloque de código.
# note: Nodo de conmutación booleana
boolean = BoolSelector(true)
watch_30 = Watch(boolean)
# note: Usar valores "true" (verdadero) o "false" (falso) en un bloque de código para obtener el mismo resultado
code_block_46 = CodeBlock { true; }
watch_31 = Watch(code_block_46)
