# Dynamo graph Core_ListAtLevel.dyn (Dynamo 3.1.0.3411)
# author: Dynamo Team
# Se explora List@Level y cómo puede utilizarse para obtener los mismos resultados que con el nodo List.Map. Se crean una serie de paneles para mostrar cómo funciona realmente List@Level.

# group: Información
# note: Para determinar el nivel de lista con el que desea trabajar, examine la parte inferior de la burbuja de vista preliminar, o bien observe y siga las líneas desde la notación de List@Level hacia arriba.

# group: Información
# Información general sobre el uso de List@Level
# note: List@level
# List@level sustituye a la función List.Map, lo que le permite seleccionar directamente el nivel de detalle con el que desea trabajar en la lista.
# note: Para cambiar el nivel de lista con el que está trabajando, haga clic en la flecha junto al puerto de entrada de lista y active la opción "Utilizar niveles".
# Cuando se activa por primera vez List@Level en un puerto de entrada, la lista en el segundo nivel más interno (L2) se selecciona para trabajar con ella.

# group: Información
# Indica el funcionamiento de este gráfico.
# note: Deseamos crear paneles en el interior de la rejilla. Para ello, necesitaremos obtener los puntos en los índices 1 y 2 de cada lista en el nivel más interno. Esto puede hacerse fácilmente mediante la función List@Level. La agrupación de las listas se conserva mediante la opción "Mantener la estructura de listas". Pero, primero, inspeccionemos la lista que hemos creado con Point.ByCoordinates un poco más para determinar el nivel de lista que deseamos utilizar.

# group: Entradas
# Descripción <Haga doble clic aquí para editar la descripción del grupo>
code_block = CodeBlock { 0..30..#8; 12..0..#4; }
# note: En este ejemplo, creamos una lista 3D que contiene una serie de puntos. Hay ocho listas en L3 y cada lista contiene otras cuatro listas (L2). Cada una de las cuatro listas contiene cuatro puntos (L1), lo que da un total de 128 puntos.
byCoordinates = Point.ByCoordinates(x=code_block.out0, y=code_block.out1, z=code_block.out1, lacing=CrossProduct)

# group: Sustitución de List.Map por List@Level
code_block_2 = CodeBlock { [1,2]; }
# note: En la versión anterior de Dynamo, List.Map se utilizaba para obtener los niveles internos de las listas. Aunque se puede lograr el mismo resultado mediante List.Map, introduce más nodos en el espacio de trabajo. Aquí usamos List@Level para capturar los puntos interiores de la rejilla de una forma más eficaz. Usaremos estos puntos para crear paneles.
# También utilizamos la opción "Mantener la estructura de listas" para mantener las agrupaciones de la lista inicial e impedir el aplanamiento. Si se ha desactivado esta opción, se creará una única NurbsSurface en lugar de ocho.
getItemAtIndex = List.GetItemAtIndex(list=byCoordinates@@L2, index=code_block_2)
code_block_3 = CodeBlock { [1,2]; }
# note: Las listas existen en diferentes niveles, siendo L1 el nivel más bajo. El número total de elementos producidos por este nodo es 64, como se muestra en la parte inferior derecha.
getItemAtIndex_2 = List.GetItemAtIndex(index=code_block_3)  # unwired: list
# note: A continuación se muestra la función List.Map equivalente a la aplicación List@Level que requiere nodos adicionales.
map = List.Map(f_x=getItemAtIndex_2)  # unwired: list
map_2 = List.Map(list=byCoordinates, f_x=map)

# group: Creación de geometría
# note: Con los conjuntos de puntos seleccionados, ahora se pueden crear paneles.
byPoints = NurbsSurface.ByPoints(points=getItemAtIndex)
byBestFitThroughPoints = Line.ByBestFitThroughPoints(bestFitPoints=getItemAtIndex)

# group: Inspección de una lista con List@Level y Count
# note: El nodo List.Count devuelve la cantidad de elementos presentes en cada lista. En función del nivel seleccionado, se devuelven diferentes valores. Pruebe a cambiar el valor de L3. Para ello, haga clic en las flechas ubicadas al lado de este.
# note: Hay ocho listas en L3, cada una con cuatro listas. Por lo tanto, la selección de L3 implementa la función List.Count en las ocho listas, lo que da como resultado ocho valores "4".
count = List.Count(list=byCoordinates@L3)

# group: Uso de "Mantener la estructura de listas"
# note: Este nodo devuelve la cantidad de elementos presentes en cada lista de L2. Por defecto, los resultados se aplanan en una lista 1D.
count_2 = List.Count(list=byCoordinates@L2)
# note: Para conservar la estructura anidada de las listas, seleccione la opción "Mantener la estructura de listas". "@@" indica cómo mantener la estructura de listas en DesignScript.
count_3 = List.Count(list=byCoordinates@@L2)

# group: Inspección de una lista con List@Level y Flatten
# note: Como ejemplo adicional, puede aplanar fácilmente la estructura anidada en los niveles internos de las listas mediante la función List@Level, junto con el nodo Flatten. Pruebe a cambiar el nivel que se aplanará. Para ello, haga clic en las flechas ubicadas al lado, en el control numérico List@Level.
# note: La selección de L3 convierte las ocho listas de ese nivel en una matriz 1D. Como cada una de las ocho listas contiene cuatro elementos (que también son listas), esto aplanará todas las listas de L3, lo que genera ocho listas de 16 puntos.
flatten = List.Flatten(list=byCoordinates@L3)
