# Dynamo graph Core_ListLacing.dyn (Dynamo 3.1.0.3411)
# author: Dynamo Team
# Encaje de lista: en este gráfico se exploran y se muestran todos los modos de encaje de lista.

# group: Información
# note: ENCAJE DE LISTAS
# El encaje es la lógica que un nodo de Dynamo utiliza para emparejar elementos de listas diferentes. La mayoría de los nodos de Dynamo permiten elegir cómo combinar listas de información definiendo el "comportamiento de encaje".
# En todos estos ejemplos, hay dos listas de puntos que se aprueban en el nodo Line.ByStartPointEndPoint. El nodo que crea la línea debe decidir qué cantidad de líneas se dibujan y entre qué conjuntos de puntos.
# Defina el comportamiento de encaje haciendo clic con el botón derecho en un nodo que tiene dos o más puertos de entrada, y seleccione "Encaje".

# group: Consejo
# note: Sugerencia: muestre el índice de elementos como etiqueta en la vista preliminar de segundo plano para cualquier nodo que cree geometría. Haga clic con el botón derecho y seleccione "Mostrar etiquetas".

# group: Consejo
# note: Consejo: en la esquina inferior derecha, se anota un comportamiento de encaje del nodo con el glifo pequeño. Si no se ve ningún glifo, el nodo no encaja.

# group: Entradas
# note: Serie más larga (10 elementos)
code_block = CodeBlock { 0..9; }
code_block_2 = CodeBlock { 4; }
# note: Serie más corta (6 elementos)
code_block_3 = CodeBlock { 0..5; }
code_block_4 = CodeBlock { 0..9; }
code_block_5 = CodeBlock { -10; 4; }
code_block_6 = CodeBlock { 0..5; }
code_block_7 = CodeBlock { 0..9; }
code_block_8 = CodeBlock { 10; 4; }
code_block_9 = CodeBlock { 0..5; }

# group: Crear puntos
# Cree dos conjuntos de puntos para (10 x 6) que se utilizarán como entrada para Line.ByStartPointEndPoint.
byCoordinates = Point.ByCoordinates(x=code_block, z=code_block_2)
byCoordinates_2 = Point.ByCoordinates(x=code_block_3)

# group: El encaje más largo
# note: Encaje más largo
# Se dibuja tantas líneas como elementos hay en la lista más larga de puntos de entrada. Cuando el nodo se queda sin puntos en la lista más corta, se harán tantas copias del último elemento como sea necesario hasta igualarlos con los elementos finales de la lista más larga.
byStartPointEndPoint = Line.ByStartPointEndPoint(startPoint=byCoordinates, endPoint=byCoordinates_2, lacing=Longest)

# group: Crear puntos
# Cree dos conjuntos de puntos para (10 x 6) que se utilizarán como entrada para Line.ByStartPointEndPoint.
byCoordinates_3 = Point.ByCoordinates(x=code_block_4, y=code_block_5.out0, z=code_block_5.out1)
byCoordinates_4 = Point.ByCoordinates(x=code_block_6, y=code_block_5.out0)

# group: El encaje más corto
# note: Encaje más corto
# Se dibuja tantas líneas como elementos hay en la lista de entrada más corta. Se descartan los puntos "sobrantes" de la lista más larga.
byStartPointEndPoint_2 = Line.ByStartPointEndPoint(startPoint=byCoordinates_3, endPoint=byCoordinates_4)

# group: Crear puntos
# Cree dos conjuntos de puntos para (10 x 6) que se utilizarán como entrada para Line.ByStartPointEndPoint.
byCoordinates_5 = Point.ByCoordinates(x=code_block_7, y=code_block_8.out0, z=code_block_8.out1)
byCoordinates_6 = Point.ByCoordinates(x=code_block_9, y=code_block_8.out0)

# group: Encaje de producto cartesiano
# note: Encaje de productos cartesianos
# Se efectúan todas las combinaciones posibles de emparejamiento. Para 10 puntos de la lista más larga y 6 de la lista más corta, el resultado será de 10 x 6 = 60 líneas.
byStartPointEndPoint_3 = Line.ByStartPointEndPoint(startPoint=byCoordinates_5, endPoint=byCoordinates_6, lacing=CrossProduct)
# note: Las líneas resultantes se guardarán en una lista anidada, ya sean 6 listas de 10 líneas o 10 listas de 6 líneas, según la lista que se especifique primero.
watch = Watch(byStartPointEndPoint_3)
