# Dynamo graph Core_Math.dyn (Dynamo 3.4.1.7055)
# author: Dynamo Team
# Se trata de una amplia exploración de las diversas funciones y capacidades matemáticas de Dynamo.

# group: Información
# note: MATEMÁTICAS
# Las operaciones matemáticas en Dynamo pueden realizarse con nodos de las bibliotecas Matemáticas y Operadores, o con un Code Block. A continuación, compruebe cómo realizar varias operaciones matemáticas básicas con cada uno de estos tres métodos.

# group: Operadores aritméticos básicos
# note: Operadores aritméticos como
# +, -, *, /, %

# group: Operadores lógicos básicos
# note: Operadores de comparación como
# <, >, <=, >=, !=, ==

# group: Operadores booleanos
# note: Operadores booleanos
# (buscar otros en la biblioteca)

# group: Redondeo
# note: Redondeo

# group: Funciones matemáticas complejas
# Cuatro ejemplos de cómo lograr el mismo resultado final mediante nodos, Python y Fo
# note: En este ejemplo, se muestran cuatro formas diferentes de abordar el tratamiento de las funciones matemáticas. Cada uno de estos ejemplos comienza con una rejilla de puntos, calcula las coordenadas Z de los puntos y, a continuación, crea una superficie. Solo varía el método de cálculo; todos estos métodos resuelven lo mismo.
# 1. Nodos. Los nodos matemáticos se encuentran en la sección Matemáticas de la Biblioteca, que a su vez se divide en Funciones, Lógica y Operadores.
# 2. Python.
# 3. Nodo Code Block. Haga doble clic en cualquier lugar del lienzo para crear un nodo Code Block. La sintaxis de cada función coincide con el nombre del nodo en Dynamo.
# ** Nota: Puede ajustar la resolución de la vista preliminar de la geometría en los parámetros de Precisión de renderización: Dynamo -> Preferencias -> Configuración visual -> Precisión de renderización.
# note: Para obtener más información sobre este ejemplo:
# http://dynamobim.org/math-transit/

# group: Arco
# note: Crear un arco mediante dos métodos distintos, uno con nodos y otro con bloques de código. Los resultados se visualizan para ofrecer mayor claridad.

# group: Consejo
# Resaltado de nodos de geometría
# note: Consejo: seleccionar un nodo que dibuje geometría hará que dicha geometría sea de color cian. Este bloque de código dibuja los ejes de un gráfico, los puntos a lo largo de la curva y luego la curva propiamente dicha. Seleccione el bloque de código para ver en segundo plano qué curva dibuja.

# group: Curva de coseno
# note: Este conjunto de ejemplos muestra cómo representar gráficamente una función de coseno mediante nodos y un bloque de código.
# Cada ejemplo utiliza una serie de números como valores x para una serie de puntos, calcula los valores y a partir de los valores x y, a continuación, dibuja una línea en forma de curva de coseno.  El gran bloque de código al final de cada gráfico desplaza la geometría dibujada a una parte diferente de la pantalla para que no se superpongan todas.

# group: Consejo
# Precisión de renderización
# note: Sugerencia: Ajuste la precisión con la que se renderiza la geometría en la vista preliminar del fondo. Para ello, acceda a Dynamo -> Preferencias -> Configuración visual -> Precisión de renderización. Un valor más alto conseguirá que las superficies curvas parezcan más suaves, pero se necesitará más potencia de procesamiento para dibujarlas.

# group: Nodos > Entrada inicial para la lista de puntos
code_block = CodeBlock { -10..10..#20; }

# group: Nodos > Creación y manipulación de la lista de puntos inicial
# note: Crea una rejilla de puntos.
# El comportamiento de encaje es
# "producto cartesiano".
byCoordinates = Point.ByCoordinates(x=code_block, y=code_block, lacing=CrossProduct)
flatten = List.Flatten(list=byCoordinates)
X = Point.X(point=flatten)
Y = Point.Y(point=flatten)

# group: Nodos > Amplitud
# note: Amplitud
number_slider = DoubleSlider(5.51, range=0..10 step 0.1)  # graph input

# group: Nodos > Cuadrado
number = DoubleInput(2)  # graph input
pow = Math.Pow(number=X, power=number)

# group: Nodos > Cuadrado
number_2 = DoubleInput(2)  # graph input
pow_2 = Math.Pow(number=Y, power=number_2)

# group: Nodos > Frecuencia
# note: Frecuencia
number_slider_2 = DoubleSlider(1.724, range=0..6 step 0.1)  # graph input

# group: Nodos > Cuadrado
number_3 = DoubleInput(2)  # graph input
pow_3 = Math.Pow(number=number_slider_2, power=number_3)

# group: Nodos > La serie de cálculos matemáticos y manipulaciones para crear la geometría de "ondulación" mediante nodos
add = pow + pow_2
add_2 = add + pow_3
sqrt = Math.Sqrt(number=add_2)
# note: Los ángulos de Dynamo están en grados.
radiansToDegrees = Math.RadiansToDegrees(radians=sqrt)
sin = Math.Sin(angle=radiansToDegrees)
div = sin / sqrt
mul = number_slider * div

# group: Nodos > Recopilar los puntos resultantes y preparar la renderización final
byCoordinates_2 = Point.ByCoordinates(x=X, y=Y, z=mul)
# note: Cuenta el número de grupos de puntos de la colección inicial de puntos (20 x 20)
count = List.Count(list=byCoordinates)

# group: Nodos > La colección de puntos
# note: Divide lista plana en series
# de listas por fila
chop = List.Chop(list=byCoordinates_2, lengths=count)

# group: Nodos > La red de curvas
# note: Crea curvas NURBS
# mediante puntos
byPoints = NurbsCurve.ByPoints(points=chop)

# group: Nodos > La superficie final
# note: Crea una superficie
byLoft = Surface.ByLoft(crossSections=byPoints)

# group: Bloque de código > Entrada inicial para la lista de puntos
code_block_2 = CodeBlock { -10..10..#20; }

# group: Bloque de código > Creación y manipulación de la lista de puntos inicial
byCoordinates_3 = Point.ByCoordinates(x=code_block_2, y=code_block_2, lacing=CrossProduct)
flatten_2 = List.Flatten(list=byCoordinates_3)
Y_2 = Point.Y(point=flatten_2)
X_2 = Point.X(point=flatten_2)

# group: Bloque de código > Función auxiliar para desplazar la geometría
# note: Desplaza la geometría sobre
code_block_3 = CodeBlock(x=Y_2) { x+60; }

# group: Bloque de código > Frecuencia
number_slider_3 = DoubleSlider(1.724, range=0..5 step 0.1)  # graph input

# group: Bloque de código > Amplitud
number_slider_4 = DoubleSlider(5.51, range=0..10 step 0.1)  # graph input

# group: Bloque de código > La serie de cálculos matemáticos y manipulaciones para crear la geometría de "ondulación" mediante Python
# note: Los nombres de los métodos math coinciden con los nombres de los nodos de Dynamo que se utilizan en el primer ejemplo.
code_block_4 = CodeBlock(x=X_2, y=Y_2, c=number_slider_3, A=number_slider_4)
# ---------- code_block_4.designscript (6 lines) ----------
sum = Math.Pow(x,2) + Math.Pow(y,2) + Math.Pow(c,2);

num1 = Math.Sqrt(sum);
num2 = Math.Sin( Math.RadiansToDegrees(num1) );

A * num2 / num1;
# ----------------------------------------

# group: Bloque de código > Recopilar los puntos resultantes y preparar la renderización final
byCoordinates_4 = Point.ByCoordinates(x=code_block_3, y=X_2, z=code_block_4.out3)
count_2 = List.Count(list=byCoordinates_3)

# group: Bloque de código > La colección de puntos
chop_2 = List.Chop(list=byCoordinates_4, lengths=count_2)

# group: Bloque de código > La red de curvas
byPoints_2 = NurbsCurve.ByPoints(points=chop_2)

# group: Bloque de código > La superficie final
byLoft_2 = Surface.ByLoft(crossSections=byPoints_2)

# group: Python > Entrada inicial para la lista de puntos
code_block_5 = CodeBlock { -10..10..#20; }

# group: Python > Creación y manipulación de la lista de puntos inicial
byCoordinates_5 = Point.ByCoordinates(x=code_block_5, y=code_block_5, lacing=CrossProduct)
flatten_3 = List.Flatten(list=byCoordinates_5)
X_3 = Point.X(point=flatten_3)
Y_3 = Point.Y(point=flatten_3)

# group: Python > Función auxiliar para desplazar la geometría
# note: Desplaza la geometría sobre
code_block_6 = CodeBlock(x=X_3) { x+30; }

# group: Python > Amplitud
number_slider_5 = DoubleSlider(5.51, range=0..10 step 0.1)  # graph input

# group: Python > Frecuencia
number_slider_6 = DoubleSlider(1.724, range=0..5 step 0.1)  # graph input

# group: Python > La serie de cálculos matemáticos y manipulaciones para crear la geometría de "ondulación" mediante Python
python_script = Python(Amplitude=number_slider_5, X=X_3, Y=Y_3, Frequency=number_slider_6)  # PythonNet3
# ---------- python_script.python (27 lines) ----------
import clr
clr.AddReference('ProtoGeometry')
from Autodesk.DesignScript.Geometry import *

import math

# The inputs to this node will be stored as a list in the IN variable.
amp = IN[0]   # single value
x = IN[1]     # list
y = IN[2]     # list (expect same length as x)
c = IN[3]     # single value

# Declare an empty array of z-values
z = []

# Solve the equation for each x and y value
for index in range(len(x)):
	sum = math.pow(x[index],2) + math.pow(y[index],2) + math.pow(c,2)
	num1 = math.sqrt(sum)
	num2 = math.sin(num1)
	zVal = amp * num2 / num1
	
	# Append the answer to the list of z values
	z.append(zVal)

# Assign the z-values to the OUT variable
OUT = z
# ----------------------------------------

# group: Python > Recopilar los puntos resultantes y preparar la renderización final
byCoordinates_6 = Point.ByCoordinates(x=code_block_6, y=Y_3, z=python_script)
count_3 = List.Count(list=byCoordinates_5)

# group: Python > La colección de puntos
chop_3 = List.Chop(list=byCoordinates_6, lengths=count_3)

# group: Python > La red de curvas
byPoints_3 = NurbsCurve.ByPoints(points=chop_3)

# group: Python > La superficie final
byLoft_3 = Surface.ByLoft(crossSections=byPoints_3)

# group: Curva de coseno con bloques de código > Entradas
# note: Punto de coordenada base
code_block_7 = CodeBlock { 25; 20; }
# note: Serie de valores X
code_block_8 = CodeBlock { 0..10..#20; }
# note: Amplitud
number_slider_7 = DoubleSlider(3, range=0..10 step 0.1)  # graph input
# note: Frecuencia
number_slider_8 = DoubleSlider(36, range=0..100 step 0.1)  # graph input

# group: Curva de coseno con bloques de código > Función de curva de coseno
# Obtenga el valor de coseno para la frecuencia y el ángulo especificados, y multiplique este valor por la amplitud.
code_block_9 = CodeBlock(amplitude=number_slider_7, frequency=number_slider_8, angle=code_block_8) { amplitude * Math.Cos(frequency * angle); }

# group: Curva de coseno con bloques de código > Operaciones intermedias
byCoordinates_7 = Point.ByCoordinates(x=code_block_7.out0, y=code_block_7.out1)
byCoordinates_8 = Point.ByCoordinates(x=code_block_8, y=code_block_9)

# group: Curva de coseno con bloques de código > Crear y visualizar la curva de coseno
code_block_10 = CodeBlock(base=byCoordinates_7, pts=byCoordinates_8)
# ---------- code_block_10.designscript (14 lines) ----------
// Make axes from base point
dimension = 10;
top = Point.ByCoordinates(base.X, base.Y + dimension/2);
bottom = Point.ByCoordinates(base.X, base.Y - dimension/2);
right = Point.ByCoordinates(base.X + 10, base.Y);
Line.ByStartPointEndPoint(bottom, top);
Line.ByStartPointEndPoint(base, right);

// Move function results to base point
vec = base.AsVector();
newPts = pts.Add(vec);

// Draw a line through the points
NurbsCurve.ByPoints(newPts);
# ----------------------------------------

# group: Curva de coseno con nodos > Entradas
# note: Coordenadas x,y del punto base
code_block_11 = CodeBlock { -5; 20; }
# note: Serie de valores X
code_block_12 = CodeBlock { 0..10..#20; }
# note: Frecuencia
number_slider_9 = DoubleSlider(36, range=0..100 step 0.1)  # graph input

# group: Curva de coseno con nodos > Controla la amplitud
# note: Amplitud
number_slider_10 = DoubleSlider(3, range=0..10 step 0.1)  # graph input

# group: Curva de coseno con nodos
mul_2 = number_slider_9 * code_block_12

# group: Curva de coseno con nodos > Función Math.Cos
# Obtenga el valor de coseno para cada número inicial.
cos = Math.Cos(angle=mul_2)

# group (continued): Curva de coseno con nodos
mul_3 = number_slider_10 * cos

# group: Curva de coseno con nodos > Operaciones intermedias
byCoordinates_9 = Point.ByCoordinates(x=code_block_11.out0, y=code_block_11.out1)
# note: Sugerencia: puede activar o desactivar la función de vista previa de cualquier nodo que cree geometría. Haga clic con el botón derecho y seleccione o anule la selección de "Vista preliminar".
byCoordinates_10 = Point.ByCoordinates(x=code_block_12, y=mul_3)

# group: Curva de coseno con nodos > Crear y visualizar la curva de coseno
code_block_13 = CodeBlock(base=byCoordinates_9, pts=byCoordinates_10)  # same code as code_block_10

# group: Arco con nodos > Entradas
# Cree las siguientes entradas necesarias:
# 1. Centro
# 2. Radio
# 3. Ángulo inicial
# 4. Ángulo final
# 5. La normal (eje Z)
code_block_14 = CodeBlock { 0; 35; }
byCoordinates_11 = Point.ByCoordinates(x=code_block_14.out0, y=code_block_14.out1)
code_block_15 = CodeBlock { 5; 0; }
# note: Mueva el control deslizante para cambiar la longitud del arco.
number_slider_11 = DoubleSlider(247.821, range=0..360 step 0.1)  # graph input
ZAxis = Vector.ZAxis()

# group: Arco con nodos > Crear un arco mediante un centro, un radio y un ángulo
# note: Los ángulos en nodos o en bloque de código están en radianes.
byCenterPointRadiusAngle = Arc.ByCenterPointRadiusAngle(center=byCoordinates_11, radius=code_block_15.out0, startAngle=code_block_15.out1, endAngle=number_slider_11, normal=ZAxis)

# group: Arco con nodos > Visualizar los resultados
endPoint = Curve.EndPoint(curve=byCenterPointRadiusAngle)
byStartPointEndPoint = Line.ByStartPointEndPoint(startPoint=endPoint, endPoint=byCoordinates_11)
startPoint = Curve.StartPoint(curve=byCenterPointRadiusAngle)
byStartPointEndPoint_2 = Line.ByStartPointEndPoint(startPoint=startPoint, endPoint=byCoordinates_11)

# group: Operaciones con nodos > -
code_block_16 = CodeBlock { 5; 2; }
sub = code_block_16.out0 - code_block_16.out1
watch = Watch(sub)

# group: Operaciones con bloques de código > -
code_block_17 = CodeBlock { 5-2; }
watch_2 = Watch(code_block_17)

# group: Operaciones con bloques de código > %
code_block_18 = CodeBlock { 5%2; }
watch_3 = Watch(code_block_18)

# group: Operaciones con nodos > %
code_block_19 = CodeBlock { 5; 2; }
mod = code_block_19.out0 % code_block_19.out1
watch_4 = Watch(mod)

# group: Operaciones con bloques de código > <=
code_block_20 = CodeBlock { 5<=2; }
watch_5 = Watch(code_block_20)

# group: Operaciones con bloques de código > >
code_block_21 = CodeBlock { 5>2; }
watch_6 = Watch(code_block_21)

# group: Operaciones con nodos > <=
code_block_22 = CodeBlock { 5; 2; }
le = code_block_22.out0 <= code_block_22.out1
watch_7 = Watch(le)

# group: Operaciones con nodos > >
code_block_23 = CodeBlock { 5; 2; }
gt = code_block_23.out0 > code_block_23.out1
watch_8 = Watch(gt)

# group: Arco mediante bloques de código > Entradas
# Cree las siguientes entradas necesarias:
# 1. Centro
# 2. Ángulo final
code_block_24 = CodeBlock { 15; 35; }
byCoordinates_12 = Point.ByCoordinates(x=code_block_24.out0, y=code_block_24.out1)
number_slider_12 = DoubleSlider(126.947, range=0..360 step 0.1)  # graph input

# group: Arco mediante bloques de código > Crear un arco mediante un centro, un radio y un ángulo
code_block_25 = CodeBlock(center=byCoordinates_12, endAngle=number_slider_12) { Arc.ByCenterPointRadiusAngle(center,5,0,endAngle,Vector.ZAxis()); }

# group: Arco mediante bloques de código > Visualizar los resultados
startPoint_2 = Curve.StartPoint(curve=code_block_25)
byStartPointEndPoint_3 = Line.ByStartPointEndPoint(startPoint=startPoint_2, endPoint=byCoordinates_12)
endPoint_2 = Curve.EndPoint(curve=code_block_25)
byStartPointEndPoint_4 = Line.ByStartPointEndPoint(startPoint=endPoint_2, endPoint=byCoordinates_12)

# group: Redondeo mediante nodos > Entradas
code_block_26 = CodeBlock { 3.14159; }
code_block_27 = CodeBlock { 3; }

# group: Redondeo mediante nodos > Redondear hacia abajo
floor = Math.Floor(number=code_block_26)
watch_9 = Watch(floor)

# group: Redondeo mediante nodos > Redondear hacia arriba
ceiling = Math.Ceiling(number=code_block_26)
watch_10 = Watch(ceiling)

# group: Redondeo mediante nodos > Redondear al alza o a la baja
# El que esté más cerca
round = Math.Round(number=code_block_26)
watch_11 = Watch(round)

# group: Redondeo mediante nodos > Redondear al número de dígitos especificado
round_2 = Math.Round(number=code_block_26, digits=code_block_27)
watch_12 = Watch(round_2)

# group: Redondeo mediante bloques de código > Entradas
code_block_28 = CodeBlock { 3.14159; }

# group: Redondeo mediante bloques de código > Redondear hacia abajo
code_block_29 = CodeBlock(num=code_block_28) { Math.Floor(num); }
watch_13 = Watch(code_block_29)

# group: Redondeo mediante bloques de código > Redondear hacia arriba
code_block_30 = CodeBlock(num=code_block_28) { Math.Ceiling(num); }
watch_14 = Watch(code_block_30)

# group: Redondeo mediante bloques de código > Redondear al alza o a la baja
# El que esté más cerca
code_block_31 = CodeBlock(num=code_block_28) { Math.Round(num); }
watch_15 = Watch(code_block_31)

# group: Redondeo mediante bloques de código > Redondear al número de dígitos especificado
# Descripción <Haga doble clic aquí para editar la descripción del grupo>
code_block_32 = CodeBlock(num=code_block_28) { Math.Round(num,3); }
watch_16 = Watch(code_block_32)

# group: Operaciones con bloques de código > == (igual a)
code_block_33 = CodeBlock { true == false; }
watch_17 = Watch(code_block_33)

# group: Operaciones con bloques de código > No es
code_block_34 = CodeBlock { !true; }
watch_18 = Watch(code_block_34)

# group: Operaciones con bloques de código > && (y)
code_block_35 = CodeBlock { true && false; }
watch_19 = Watch(code_block_35)

# group: Operaciones con bloques de código > || (o)
code_block_36 = CodeBlock { true || false; }
watch_20 = Watch(code_block_36)

# group: Operaciones con nodos > == (igual a)
boolean = BoolSelector(true)  # graph input
boolean_2 = BoolSelector(false)  # graph input
eq = boolean == boolean_2
watch_21 = Watch(eq)

# group: Operaciones con nodos > || (o)
boolean_3 = BoolSelector(true)  # graph input
boolean_4 = BoolSelector(false)  # graph input
or_ = boolean_3 || boolean_4
watch_22 = Watch(or_)

# group: Operaciones con nodos > && (y)
boolean_5 = BoolSelector(true)  # graph input
boolean_6 = BoolSelector(false)  # graph input
and_ = boolean_5 && boolean_6
watch_23 = Watch(and_)

# group: Operaciones con nodos > No es
boolean_7 = BoolSelector(true)  # graph input
not_ = Not(x=boolean_7)
watch_24 = Watch(not_)
