# Dynamo graph Core_PassingFunctions.dyn (Dynamo 3.1.0.3411)
# author: Dynamo Team
# Muestra cómo transferir una función en Dynamo.

# group: Información
# note: PASAR FUNCIONES
# Dynamo es un lenguaje funcional. Eso significa que las acciones se pueden tratar de la misma manera que los objetos. Casi todos los nodos de Dynamo se pueden convertir en funciones y utilizarse de manera muy concreta en un conjunto de datos.
# Crear una función y pasarla equivale a emitir el comando "Ejecutar durante 20 minutos" pero especificando después a quién se refiere.
# En este ejemplo, una rejilla de círculos se representa en una estructura compleja. El comando para seleccionar un conjunto de círculos se utiliza directamente y después se pasa como función a niveles inferiores de datos para obtener un resultado diferente.

# group: Entradas iniciales
# Cree una matriz de puntos de 5 x 8.
code_block = CodeBlock { 0..#8..4; }
code_block_2 = CodeBlock { 0..#5..4; }
byCoordinates = Point.ByCoordinates(x=code_block, y=code_block_2, lacing=CrossProduct)

# group: Dibujar matriz de círculos
# note: Esta lista de puntos se organiza en una estructura jerárquica; es una lista de listas. La rejilla se ha efectuado con 8 puntos en la dirección X y 5 en la dirección Y. Esta lista representa 8 listas de 5 cosas o listas de columnas de puntos.
watch = Watch(byCoordinates)
code_block_3 = CodeBlock { 1.5; }
# note: Dibuja un círculo alrededor de cada punto.
byCenterPointRadius = Circle.ByCenterPointRadius(centerPoint=watch, radius=code_block_3)

# group: Seleccionar la segunda y la tercera LISTA
# Transferencia de la función
code_block_4 = CodeBlock { 1..2; }
# note: En la lista anidada de círculos, se eligen los elementos {1,2}. Los nodos de Dynamo siempre actuarán en una lista "de fuera a dentro" o del nivel más alto al nivel más bajo.
# Seleccionar los elementos 1 y 2 de la lista devolverá la lista núm. 1 y la lista núm. 2 de la estructura original de listas anidadas.
getItemAtIndex = List.GetItemAtIndex(list=byCenterPointRadius, index=code_block_4)

# group: Extruir ARRIBA
# Cilindros resultantes
# note: Los datos seleccionados todavía existen en la misma estructura que tenía antes de seleccionarse por asignación.
watch_2 = Watch(getItemAtIndex)
code_block_5 = CodeBlock { 3; }
# note: Esta lista de círculos se extruye hacia arriba.
extrude = Curve.Extrude(curve=watch_2, distance=code_block_5)

# group: Seleccionar el segundo y el tercer ELEMENTO de CADA LISTA
# Transferencia de la función
code_block_6 = CodeBlock { 1..2; }
# note: Más que tomar las dos primeras listas de la salida del nodo, la función List@Level permite tomar el elemento #1 y #2 de cada lista, seleccionando L2 en el puerto de entrada de List.GetItemAtIndex.
# Esta función resuelve el funcionamiento de List.Map, método que se utilizaba para acceder a los niveles internos de listas de entrada en las versiones anteriores de Dynamo.
getItemAtIndex_2 = List.GetItemAtIndex(list=byCenterPointRadius@L2, index=code_block_6)

# group: Extruir ABAJO
# Cilindros resultantes
watch_3 = Watch(getItemAtIndex_2)
code_block_7 = CodeBlock { -3; }
# note: Esta lista de círculos se extruye hacia abajo.
extrude_2 = Curve.Extrude(curve=watch_3, distance=code_block_7)
