# Dynamo graph Core_Python.dyn (Dynamo 4.1.0.2940)
# author: Dynamo Team
# Uso del nodo de Python en Dynamo

# group: Información
# note: PYTHON
# Dynamo admite Python en uno de los dos tipos de nodos de Python. (Un segundo tipo de nodo de Python, que no se muestra aquí, puede leer una secuencia de comandos de un archivo externo para ejecutarse).
# Haga doble clic en el nodo de Python para ver la secuencia de comandos que contiene.
# La entrada está en la matriz IN. La salida se debe asignar a la variable OUT. La salida puede ser un solo valor o la matriz propiamente dicha.

# group: Uso del nodo de Python para aplicar la manipulación de signos a la lista
# note: Este ejemplo sumará o restará todos los elementos de una lista. Sus entradas son un número cuyo signo determina si se utiliza la adición o la sustracción, y una lista de números.

# group: Elegir un número positivo, 0 o negativo
# Descripción <Haga doble clic aquí para editar la descripción del grupo>
# note: Elegir el signo de la operación
#     number < 0      restar cada
#     number = 0      0
#     number > 0      sumar cada
integer_slider = IntegerSlider(1, range=-1..2 step 1)

# group: Crear lista de entradas
# note: Crear cualquier lista
code_block = CodeBlock { 0..10; }
watch = Watch(code_block)

# group: Python
# Aplica la manipulación de signos.
# note: La salida de OUT es una matriz en la que el primer elemento es un solo valor y el segundo una lista de valores. Esta estructura de datos se especificó en la propia definición de Python. Especificar una matriz permite enviar cualquier cantidad de salidas al gráfico de Dynamo.
python_script = Python(Sign=integer_slider, List=watch)  # PythonNet3
# ---------- python_script.python (31 lines) ----------
# Python script to find add or subtract a series of numbers. 

# Boiler-plate import statments included out-of-the-box
import clr
clr.AddReference('ProtoGeometry')
from Autodesk.DesignScript.Geometry import *

# The inputs to this node will be stored as a list in the IN variable.
sign = IN[0]  # -1 for subtract all, 0 for do nothing, 1 for add all
nums = IN[1]  # List of numbers to subtract or add

partials = [] # Empty array to contain partial sums or differences
result = 0    # Initialize the sum or difference to 0

# Loop through each item and add it or subtract it from the result.
for index in range(len(nums)):
	if sign > 0:
		result = result + nums[index]
		partials.append(result)
	elif sign == 0:
		partials.append(result)
		continue
	else:
		result = result - nums[index]
		partials.append(result)

# Assign the output to the OUT variable
#OUT = results  # Use this to output only the result.
OUT = []
OUT.append(result)
OUT.append(partials)
# ----------------------------------------

# group: Lista resultante
code_block_2 = CodeBlock { 1; }
getItemAtIndex = List.GetItemAtIndex(list=python_script, index=code_block_2)
# note: La serie de resultados parciales
watch_2 = Watch(getItemAtIndex)

# group: Suma resultante
code_block_3 = CodeBlock { 0; }
getItemAtIndex_2 = List.GetItemAtIndex(list=python_script, index=code_block_3)
# note: El resultado total
watch_3 = Watch(getItemAtIndex_2)

# group: Creación de geometría de Python
# note: Este ejemplo de Python no tiene entradas. Demuestra cómo crear geometría mediante la biblioteca de protogeometría de Dynamo. Como el nodo de Python crea geometría visible, si se selecciona, como cualquier otro nodo, la geometría se resaltará.
python_script_2 = Python()  # PythonNet3
# ---------- python_script_2.python (24 lines) ----------
import clr
clr.AddReference('ProtoGeometry')
from Autodesk.DesignScript.Geometry import *
#The inputs to this node will be stored as a list in the IN variable.
dataEnteringNode = IN

p1 = Point.ByCoordinates(0, 0, 0);
p2 = Point.ByCoordinates(-10, -10, -10);

l = Line.ByStartPointEndPoint(p1, p2);

pts = [
	Point.ByCoordinates(0, 0, 0),
	Point.ByCoordinates(10, 10, 0),
	Point.ByCoordinates(20, 0, 0),
	Point.ByCoordinates(30, 10, 0),
	Point.ByCoordinates(40, 0, 0) ]
	
spline = NurbsCurve.ByPoints(pts)

surf = spline.Extrude(Vector.ByCoordinates(0, 0, 1), 10)

#Assign your output to the OUT variable
OUT = [l, spline, surf]
# ----------------------------------------

# group: Revisar salida resultante
# note: Sugerencia: utilice un Code Block para
# acceder a determinados elementos de una lista.
code_block_4 = CodeBlock(output=python_script_2) { output[0]; output[1]; output[2]; }
watch_4 = Watch(code_block_4.out2)
watch_5 = Watch(code_block_4.out0)
watch_6 = Watch(code_block_4.out1)
