# Dynamo graph Core_RangeSyntax.dyn (Dynamo 3.0.0.6964)
# author: Dynamo Team
# Este gráfico ofrece varias formas de generar series de números o caracteres separados uniformemente.

# group: Información
# note: Sintaxis de rango
# Hay varias formas de crear listas como secuencias de números o caracteres.
# Las secuencias pueden resultar útiles a la hora de crear matrices de elementos e iteraciones, además de como preparación para diversas funciones y ecuaciones.

# group: Uso de bloque de código
# note: start..end..step
# De 0 a 10 con un paso de 2.
# Este método equivale a utilizar el nodo Range.
code_block = CodeBlock { 0..10..2; }
watch = Watch(code_block)
# note: start..end
# Cuando no se especifica el valor del paso, se presupone que es 1.
# Este método es idéntico al uso del nodo Range.
# note: Usar la sintaxis de rango en un nodo Code Block. Existen varios Y dispone de diversos métodos para generar series de números (o caracteres):
#         start..end..step
#         start..end..#amount
#         start..#amount..interval
# start = número/carácter que inicia la serie
# end = número/carácter que finaliza la serie
# step = diferencia entre dos números/caracteres consecutivos
# amount = cantidad de números/caracteres de la serie
code_block_2 = CodeBlock { 0..10; }
watch_2 = Watch(code_block_2)
# note: start..end..#amount
# De 0 a 10 en 3 pasos.
code_block_3 = CodeBlock { 0..10..#3; }
watch_3 = Watch(code_block_3)
# note: start..#amount..interval
# 10 pasos a partir de 0; cada paso igual a 3.
# Este método equivale a utilizar el nodo Sequence.
code_block_4 = CodeBlock { 0..#10..3; }
watch_4 = Watch(code_block_4)

# group: Utilizar bloque de código con entrada dinámica
integer_slider = IntegerSlider(7, range=0..10 step 1)
# note: Sustituir un valor por una variable y utilizar un control deslizante para controlar dinámicamente la longitud de la lista
code_block_5 = CodeBlock(howMany=integer_slider) { 0..#howMany..3; }
watch_5 = Watch(code_block_5)

# group: Uso de secuencia
number = DoubleInput(0)
number_slider = DoubleSlider(8, range=0..10 step 0.1)
number_2 = DoubleInput(2)
# note: Utilice un nodo Sequence si se conocen el número de elementos de la lista y la longitud de cada paso. El último resultado de la lista no está predefinido, sino que se calcula en función de otras entradas.
# Por ejemplo, el diseño de un aparcamiento con plazas para ocho coches y una anchura conocida para cada plaza. La anchura total de todas las plazas de aparcamiento depende de las anchuras individuales y del número de plazas.
sequence = Sequence(start=number, amount=number_slider, step=number_2, lacing=Longest)
watch_6 = Watch(sequence)

# group: Uso de rango
number_3 = DoubleInput(0)
number_4 = DoubleInput(10)
number_slider_2 = DoubleSlider(1.75, range=0..10 step 0.1)
# note: Utilice un nodo Range si se conocen el inicio y el final de la secuencia. El número de elementos de la lista resultante no está predefinido, sino que se calcula en función de otras entradas.
# Cabe señalar que el último elemento de la lista podría no coincidir con la entrada "end" si el valor de step se extiende más allá de este final al superarlo en un paso adicional.
# Si aumenta el valor de step entre las entradas "start" y "end"', obtendrá menos elementos, y viceversa, si reduce el valor de step, aumentará la longitud de la lista.
range = Range(start=number_3, end=number_4, step=number_slider_2, lacing=Longest)
watch_7 = Watch(range)

# group: Uso de rango con cadenas
string = StringInput("A")
string_2 = StringInput("P")
code_block_6 = CodeBlock { 1; }
# note: El rango también se puede utilizar para generar secuencias de caracteres.
range_2 = Range(start=string, end=string_2, step=code_block_6, lacing=Longest)
watch_8 = Watch(range_2)

# group: Uso de secuencia con cadenas
string_3 = StringInput("A")
code_block_7 = CodeBlock { 20; }
# note: Utilizar un nodo Sequence para generar una serie de letras en orden alfabético
sequence_2 = Sequence(start=string_3, amount=code_block_7)
watch_9 = Watch(sequence_2)

# note: Utilizar la secuencia de valores para crear una serie de puntos
byCoordinates = Point.ByCoordinates(x=code_block_5)
