# Dynamo graph Core_Strings.dyn (Dynamo 3.4.1.7055)
# author: Dynamo Team
# Este gráfico muestra las acciones que pueden realizarse en las cadenas.

# group: Información
# note: CADENAS
# Este conjunto de ejemplos muestra algunas acciones que se pueden realizar con cadenas. Puede encontrar más nodos para operaciones con cadenas en la biblioteca de nodos, en la categoría "String".

byCoordinates = Point.ByCoordinates()
code_block = CodeBlock { 5; }
# note: Crear un objeto: un círculo
byCenterPointRadius = Circle.ByCenterPointRadius(centerPoint=byCoordinates, radius=code_block)

# group: Convertir objeto en cadena
# note: Convierte un objeto en una descripción de cadena de sí mismo.
string_from_object = FromObject(obj=byCenterPointRadius)

watch = Watch(string_from_object)

# group: Dividir cadena mediante separadores
code_block_2 = CodeBlock { "("; ")"; " "; "="; ","; }
# note: Dividir una cadena en partes mediante la especificación de uno o más caracteres de separación. Cada separador puede tener uno o varios caracteres.
split = String.Split(string=watch, separator0=code_block_2.out0, separator1=code_block_2.out1, separator2=code_block_2.out2, separator3=code_block_2.out3, separator4=code_block_2.out4)

watch_2 = Watch(split)

# group: Comprobar si la cadena contiene subcadenas
code_block_3 = CodeBlock { "."; }
# note: Busca si una cadena contiene otra cadena.
contains = String.Contains(string=watch_2, searchFor=code_block_3)

watch_3 = Watch(contains)

# group: Crear cadena
# note: Usar un Code Block para crear una cadena (las comillas delimitan el valor de la cadena)
code_block_4 = CodeBlock { "Few things are harder to put up with than a good example."; }

# group: Cambiar a MAYÚSCULAS
string = StringInput(" - Mark Twain")
# note: Cambia la caja de una cadena
toUpper = String.ToUpper(string=string)
watch_4 = Watch(toUpper)

# group: Concatenar
# note: Enlazar dos cadenas para crear una sola se denomina "concatenación".
concat = String.Concat(string0=code_block_4, string1=watch_4)

watch_5 = Watch(concat)

# group: Reemplazar caracteres en una cadena
code_block_5 = CodeBlock { "put"; }
code_block_6 = CodeBlock { "come"; }
# note: Sustituir todas las incidencias de una subcadena por una cadena de reemplazo
replace = String.Replace(string=watch_5, searchFor=code_block_5, replaceWith=code_block_6)

watch_6 = Watch(replace)

# group: Localizar una subcadena en una cadena
code_block_7 = CodeBlock { " to"; }
# note: Buscar la ubicación de una determinada subcadena en una cadena. El resultado es el índice en el que comienza la subcadena.
indexOf = String.IndexOf(string=watch_6, searchFor=code_block_7)
watch_7 = Watch(indexOf)

# group: Longitud de cadena
# note: Busca el número total de caracteres de una cadena.
length = String.Length(string=watch_6)
watch_8 = Watch(length)

# note: Sustraer la primera parte de la cadena de su longitud total
sub = watch_8 - watch_7

# group: Eliminar caracteres
# note: Elimina un determinado número de caracteres de una cadena.
remove = String.Remove(string=watch_6, startIndex=watch_7, count=sub)

# group: Contar instancias
watch_9 = Watch(remove)
code_block_8 = CodeBlock { "ar"; }
# note: Contar las incidencias de una subcadena dentro de una cadena
countOccurrences = String.CountOccurrences(string=watch_9, searchFor=code_block_8)
watch_10 = Watch(countOccurrences)

# group: Crear cadena
# note: If the string includes a " character, use an escape character \ before " to treat it as a part of the string and not the end of the string.
code_block_9 = CodeBlock { "There is no \"I\" in Team"; }
watch_11 = Watch(code_block_9)

rango_de_números = CodeBlock { 2..101; }

# group: Concatenar cadenas mediante adición
code_block_10 = CodeBlock { " Dalmatians"; }
# note: La operación de adición convierte automáticamente números en cadenas y realiza la concatenación
add = rango_de_números + code_block_10
watch_12 = Watch(add)

# group: Convertir objeto en cadena
# note: A veces es necesario convertir primero un objeto en una cadena
string_from_object_2 = FromObject(object=rango_de_números)
watch_13 = Watch(string_from_object_2)
type = Object.Type(object=string_from_object_2)
watch_14 = Watch(type)

# group: Convertir cadena en número
code_block_11 = CodeBlock { "101 Dalmatians"; }
code_block_12 = CodeBlock { " "; }
# note: Dividir la cadena en palabras mediante el espacio como separador
split_2 = String.Split(string=code_block_11, separator0=code_block_12)
# note: Obtener el primer elemento de una lista
firstItem = List.FirstItem(list=split_2)
# note: Convertir la cadena en un número
toNumber = String.ToNumber(string=firstItem)
watch_15 = Watch(toNumber)
type_2 = Object.Type(object=toNumber)
watch_16 = Watch(type_2)

# group: Convertir las cadenas en números
# note: Utilizar la lista booleana como máscara para un filtro a fin de obtener todos los números de una lista
filterByBoolMask = List.FilterByBoolMask(list=watch_2, mask=contains)
# note: Convertir las cadenas en números
toNumber_2 = String.ToNumber(string=filterByBoolMask.in)

watch_17 = Watch(filterByBoolMask.in)
