# Dynamo graph Geometry_Curves.dyn (Dynamo 3.1.0.3411)
# author: Dynamo Team
# Un gráfico de ejemplo que muestra cómo crear las primitivas de curva básicas: línea, PolyCurve y curva NURBS abierta y cerrada.

# group: Información
# note: Este gráfico demuestra cómo crear las primitivas básicas de curva: línea, PolyCurve y curva NURBS abierta y cerrada

# group: Entradas iniciales
number = DoubleInput(5)
number_2 = DoubleInput(10)
number_3 = DoubleInput(15)

# group: Cuatro puntos iniciales
byCoordinates = Point.ByCoordinates()
byCoordinates_2 = Point.ByCoordinates(y=number)
byCoordinates_3 = Point.ByCoordinates(x=number_2, y=number_2)
byCoordinates_4 = Point.ByCoordinates(x=number_3)

# group: Lista de cuatro puntos
create = List.Create(item0=byCoordinates, item1=byCoordinates_2, item2=byCoordinates_3, item3=byCoordinates_4)

# group: Curva NURBS
# note: Crea una curva NURBS a partir de cuatro puntos
byPoints = NurbsCurve.ByPoints(points=create)

# group: Línea
# note: Una única línea recta a partir de dos puntos
byStartPointEndPoint = Line.ByStartPointEndPoint(startPoint=byCoordinates, endPoint=byCoordinates_2)

length = Curve.Length(curve=byStartPointEndPoint)

# group: Curva NURBS: cerrada
boolean = BoolSelector(true)
# note: Crear una curva NURBS cerrada dentro de los puntos delimitadores
byControlPoints = NurbsCurve.ByControlPoints(points=create, closeCurve=boolean)

# group: PolyCurve
# Descripción <Haga doble clic aquí para editar la descripción del grupo>
# note: Crear una PolyCurve recta a través de un conjunto de puntos
# note: Nueva nota
byPoints_2 = PolyCurve.ByPoints(points=create)

# group: Acciones y consultas
code_block = CodeBlock { 0..1..#20; }
# note: Las curvas, policurvas (colecciones de curvas), NURB y líneas derivan de "Curvas", por lo tanto todas las "acciones" y "consultas" de curvas se pueden realizar en todas ellas.
pointAtParameter = Curve.PointAtParameter(curve=byPoints_2, param=code_block)
