# Dynamo graph Geometry_Points.dyn (Dynamo 3.1.0.3411)
# author: Dynamo Team
# Crear matriz de puntos

# group: Entradas iniciales
number_slider = DoubleSlider(6.4, range=0..10 step 0.1)

# group: Punto único
# note: Los elementos geométricos básicos presentan valores por defecto para las entradas numéricas. Para comprobar los valores por defecto, coloque el puntero sobre el puerto de entrada del nodo.
byCoordinates = Point.ByCoordinates(z=number_slider)

# group: Previsualizar resultados
# note: Tras pulsar "Ejecutar" o con la opción Ejecutar automáticamente activada, aparecerá la entidad geométrica en la vista preliminar en segundo plano, en Watch 3D, o como datos en un nodo Watch.  Los elementos se resaltarán en el fondo cuando se seleccione el nodo.
watch_3d = Watch3D(byCoordinates)

# group: Entradas iniciales
number = DoubleInput(0)
number_2 = DoubleInput(10)
number_3 = DoubleInput(1)

# group: Rango de números
# note: Las matrices de Geometry se pueden crear mediante secuencias, rangos y listas.
range = Range(start=number, end=number_2, step=number_3, lacing=Longest)

# group: Matriz de puntos
# note: Cree matrices de 1, 2 y 3 dimensiones mediante la transferencia de rangos a los puertos x, y, z de los puntos y el posterior cambio de las propiedades de encaje en el menú contextual del nodo. Observe el resultado al elegir la opción de encaje Producto cartesiano.
byCoordinates_2 = Point.ByCoordinates(x=range, y=range, lacing=CrossProduct)

watch = Watch(byCoordinates)

# group: Convertir punto en vector
# Descripción <Haga doble clic aquí para editar la descripción del grupo>
# note: Algunos elementos se pueden convertir fácilmente en otros
asVector = Point.AsVector(point=watch)

# group: Desplazar la matriz por el punto como un vector
# note: Los elementos derivativos se pueden crear mediante herramientas en la subcategoría Actions de la entidad.
add = Point.Add(point=byCoordinates_2, vectorToAdd=asVector)

# group: Previsualizar la coordenada "Z" de un punto
# note: Se puede extraer información de la geometría mediante los nodos de la subcategoría Consulta de cada agrupación de nodos (junto al símbolo de interrogación)
Z = Point.Z(point=byCoordinates)
