# Dynamo graph Geometry_Solids.dyn (Dynamo 3.1.0.3411)
# author: Dynamo Team
# Un gráfico de ejemplo de Dynamo que muestra la creación de sólidos mediante solevación y la manipulación de sólidos (suma y resta).

# group: Puntos iniciales para el primer grupo de curvas
byCoordinates = Point.ByCoordinates()
number = DoubleInput(10)
byCoordinates_2 = Point.ByCoordinates(x=number)
byCoordinates_3 = Point.ByCoordinates(y=number)

# group: Punto adicional para el segundo grupo de curvas
number_2 = DoubleInput(5)
byCoordinates_4 = Point.ByCoordinates(z=number_2)

# group: Crear las curvas iniciales para la base inferior
byStartPointEndPoint = Line.ByStartPointEndPoint(startPoint=byCoordinates, endPoint=byCoordinates_2)
byThreePoints = Arc.ByThreePoints(firstPoint=byCoordinates, secondPoint=byCoordinates_4, thirdPoint=byCoordinates_2)

# group: Crear base inferior
create = List.Create(item0=byStartPointEndPoint, item1=byThreePoints)
byJoinedCurves = PolyCurve.ByJoinedCurves(curves=create)

# group: Punto adicional para el tercer grupo de curvas
number_3 = DoubleInput(15)
byCoordinates_5 = Point.ByCoordinates(x=number_3, y=number_3)

# group: Punto adicional para el cuarto grupo de curvas
number_4 = DoubleInput(5)
number_5 = DoubleInput(10)
byCoordinates_6 = Point.ByCoordinates(x=number_4, y=number_5, z=number_5)

# group: Crear las curvas iniciales para la base superior
byStartPointEndPoint_2 = Line.ByStartPointEndPoint(startPoint=byCoordinates_3, endPoint=byCoordinates_5)
byThreePoints_2 = Arc.ByThreePoints(firstPoint=byCoordinates_3, secondPoint=byCoordinates_6, thirdPoint=byCoordinates_5)

# group: Crear base superior
create_2 = List.Create(item0=byStartPointEndPoint_2, item1=byThreePoints_2)
byJoinedCurves_2 = PolyCurve.ByJoinedCurves(curves=create_2)

# group: Combinar curvas base en una lista
create_3 = List.Create(item0=byJoinedCurves, item1=byJoinedCurves_2)

# group: Solevar
# note: La mayoría de los sólidos se pueden crear de varias maneras. Estos ejemplos muestran perfiles cerrados como base, pero se les pueden coser PolySurfaces y hay disponibles muchas primitivas (superficies, cubo, cono, etc.).
byLoft = Solid.ByLoft(crossSections=create_3)

# group: Volumen
# note: Puede comprobar el volumen de la solevación para mostrar que se trata de una geometría de sólido cerrada
volume = Solid.Volume(solid=byLoft)

# group: Punto adicional para la geometría de solevación adicional
number_6 = DoubleInput(-2)
number_7 = DoubleInput(5)
byCoordinates_7 = Point.ByCoordinates(x=number_6, y=number_7)

# group: Combinar puntos en una lista
create_4 = List.Create(item0=byCoordinates, item1=byCoordinates_7, item2=byCoordinates_3)

# group: Crear una curva base adicional
# Descripción <Haga doble clic aquí para editar la descripción del grupo>
# note: Esta vez se crea una curva NURBS a partir del grupo de puntos
byPoints = NurbsCurve.ByPoints(points=create_4)

# group: Solevar +
# note: Sugerencia: desactive "Vista preliminar" en el menú contextual del nodo para excluir elementos de la visualización.
byLoft_2 = Solid.ByLoft(crossSections=create_3, guideCurves=byPoints)

# group: Geometría +
code_block = CodeBlock { Vector.ByCoordinates(-20,0,0); }
# note: Desplazar geometría para visualizar la salida
translate = Geometry.Translate(geometry=byLoft_2, direction=code_block)

# group: Preparar los "ingredientes" para recortar la geometría de un sólido
# note: Grosor
code_block_2 = CodeBlock { 0; }
# note: Sugerencia: desactive "Vista preliminar" en el menú contextual del nodo para excluir elementos de la visualización.
thinShell = Solid.ThinShell(solid=byLoft, internalFaceThickness=code_block_2)
code_block_3 = CodeBlock { Vector.ByCoordinates(20,0,0); }
# note: Desplazar geometría en la dirección X 20 unidades
translate_2 = Geometry.Translate(geometry=thinShell, direction=code_block_3)
code_block_4 = CodeBlock { Point.ByCoordinates(0,0,5); }
ZAxis = Vector.ZAxis()
# note: Crear un plano que atraviese el sólido por el que cortar
byOriginNormal = Plane.ByOriginNormal(origin=code_block_4, normal=ZAxis)
# note: Este punto determina qué parte del sólido se va a recortar
code_block_5 = CodeBlock { Point.ByCoordinates(10,10,10); }

# group: Solevar -
# note: Las operaciones booleanas geométricas (intersección, diferencia, unión, etc.) están disponibles en la categoría Geometry.
trim = Geometry.Trim(geometry=translate_2, other=byOriginNormal, pick=code_block_5)
