# Dynamo graph Geometry_Surfaces.dyn (Dynamo 3.1.0.3411)
# Un gráfico de Dynamo que muestra los principales métodos de creación de superficies: extrusión, solevación y barrido.

# group: Información
# note: Un gráfico de Dynamo que muestra los principales métodos de creación de superficies: extrusión, solevación y barrido

# group: Entrada
number = DoubleInput(10)
number_2 = DoubleInput(-10)
byCoordinates = Point.ByCoordinates(x=number, y=number_2)
byCoordinates_2 = Point.ByCoordinates(y=number_2)

# group: Línea
byStartPointEndPoint = Line.ByStartPointEndPoint(startPoint=byCoordinates, endPoint=byCoordinates_2)

# group: Entrada
byCoordinates_3 = Point.ByCoordinates()

# group: Entrada
number_3 = DoubleInput(5)
byCoordinates_4 = Point.ByCoordinates(z=number_3)

# group: Entrada
number_4 = DoubleInput(10)
byCoordinates_5 = Point.ByCoordinates(x=number_4)
byCoordinates_6 = Point.ByCoordinates(y=number_4)

# group: Arco
byThreePoints = Arc.ByThreePoints(firstPoint=byCoordinates_3, secondPoint=byCoordinates_4, thirdPoint=byCoordinates_5)

# group: Solevar
create = List.Create(item0=byStartPointEndPoint, item1=byThreePoints)
# note: No se puede crear una geometría de "solevación" entre dos conjuntos de curvas
byLoft = Surface.ByLoft(crossSections=create)

# group: Evaluar área de solevación
area = Surface.Area(surface=byLoft)
watch = Watch(area)

# group: Entrada
number_5 = DoubleInput(5)
number_6 = DoubleInput(10)
byCoordinates_7 = Point.ByCoordinates(x=number_5, y=number_6, z=number_6)

# group: Entrada
number_7 = DoubleInput(15)
byCoordinates_8 = Point.ByCoordinates(x=number_7, y=number_7)

# group: Arco
byThreePoints_2 = Arc.ByThreePoints(firstPoint=byCoordinates_6, secondPoint=byCoordinates_7, thirdPoint=byCoordinates_8)

# group: Entrada
number_8 = DoubleInput(-5)
number_9 = DoubleInput(5)
byCoordinates_9 = Point.ByCoordinates(x=number_8, y=number_9)

# group: Arco
byThreePoints_3 = Arc.ByThreePoints(firstPoint=byCoordinates_3, secondPoint=byCoordinates_9, thirdPoint=byCoordinates_6)

# group: Barrido
# note: La mayoría de las superficies se pueden crear de varias maneras. Las superficies, PolySurfaces (colecciones de superficies) y superficies NURB se pueden crear mediante puntos o curvas, y derivarse de otros sólidos y superficies.
bySweep2Rails = Surface.BySweep2Rails(path=byThreePoints_2, guideRail=byThreePoints, profile=byThreePoints_3)

# group: Combinar la solevación y el barrido
create_2 = List.Create(item0=byLoft, item1=bySweep2Rails)
# note: Las superficies unidas como PolySurfaces se pueden evaluar como una sola entidad.
byJoinedSurfaces = PolySurface.ByJoinedSurfaces(surfaces=create_2)

# group: Evaluar la combinación de solevación + área de barrido
area_2 = Surface.Area(surface=byJoinedSurfaces)
watch_2 = Watch(area_2)

# group: Evaluar área de barrido
area_3 = Surface.Area(surface=bySweep2Rails)
watch_3 = Watch(area_3)

# group: Extraer y utilizar puntos de la superficie
code_block = CodeBlock { 0..1..0.1; }
# note: Las aristas, los puntos y otros elementos se pueden derivar de superficies aplicando acciones adecuadas a esas geometrías.
pointAtParameter = Surface.PointAtParameter(surface=bySweep2Rails, u=code_block, v=code_block, lacing=CrossProduct)
# note: Cree una nueva superficie NURBS mediante los parámetros extraídos (puntos).
# Oculte el resto de las geometrías para observar el resultado de la siguiente.
byControlPoints = NurbsSurface.ByControlPoints(controlVertices=pointAtParameter)
watch_3d = Watch3D(byControlPoints)

# group: Extruir
code_block_2 = CodeBlock { 10; }
# note: Una extrusión básica de la curva proporcionada
extrude = Curve.Extrude(curve=byThreePoints_2, distance=code_block_2)
