# Dynamo graph ImportExport_CSV to Stuff.dyn (Dynamo 3.1.0.3411)
# author: Dynamo Team
# Crear geometría basada en datos de csv analizados

# group: Entrada inicial de helix.csv
# note: Busca un archivo CSV que tenga números
# en el espacio de coordenadas x, y y z
file_path = Filename("..\..\Data\helix.csv")

# group: Leer el archivo
fromPath = FileObject(path=file_path)  # "File.FromPath"
readText = FileSystem.ReadText(file=fromPath)

# group: Analizar los datos del archivo csv
string = StringInput("\n")
# note: Divide la cadena en
# un salto de línea <enter>
split = String.Split(string=readText, separator0=string)
string_2 = StringInput(",")
# note: Divide la cadena en la coma
split_2 = String.Split(string=split, separator0=string_2)
# note: Los archivos CSV proporcionan cadenas, no números
toNumber = String.ToNumber(string=split_2)
# note: Agrupa componentes X, Y y Z
transpose = List.Transpose(lists=toNumber)

# group: Crear la geometría de "espiral" en función de los puntos recuperados del archivo csv
# note: Coordenada "X"
firstItem = List.FirstItem(list=transpose)
code_block = CodeBlock { 1; }
# note: Coordenada "Y"
getItemAtIndex = List.GetItemAtIndex(list=transpose, index=code_block)
# note: Coordenada "Z"
lastItem = List.LastItem(list=transpose)
byCoordinates = Point.ByCoordinates(x=firstItem, y=getItemAtIndex, z=lastItem)

# group: Aumentar escala
number_slider = DoubleSlider(2.337, range=0..20 step 0.1)
# note: Ajusta la distribución total
# de los puntos de coordenadas
scale = Geometry.Scale(geometry=byCoordinates, amount=number_slider, lacing=Longest)
