# Dynamo graph ImportExport_Data To Excel.dyn (Dynamo 3.1.0.3411)
# author: Dynamo Team
# Muestra cómo exportar datos de Dynamo a un archivo .csv.

# group: Título <Haga doble clic aquí para editar el título del grupo>
number_slider = DoubleSlider(1.793, range=0..5 step 0.1)

# group: Título <Haga doble clic aquí para editar el título del grupo>
# Descripción <Haga doble clic aquí para editar la descripción del grupo>
# note: Nueva nota
code_block = CodeBlock(numCircles=number_slider) { 0..(360*numCircles)..10; }
cos = Math.Cos(angle=code_block, lacing=Longest)
sin = Math.Sin(angle=code_block, lacing=Longest)
code_block_2 = CodeBlock(x=code_block) { x/100; }
byCoordinates = Point.ByCoordinates(x=cos, y=sin, z=code_block_2, lacing=Longest)
code_block_3 = CodeBlock(pt=byCoordinates) { [pt.X,pt.Y,pt.Z]; }

# group: Título <Haga doble clic aquí para editar el título del grupo>
# Descripción <Haga doble clic aquí para editar la descripción del grupo>
# note: Nueva nota
file_path = Filename("..\..\Data\icosohedron_points.csv")
string = StringInput("helix")
number = DoubleInput(0)
transpose = List.Transpose(lists=code_block_3)
exportToExcel = Data.ExportToExcel(filePath=file_path, sheetName=string, startRow=number, startColumn=number, data=transpose)
