# Dynamo graph ImportExport_Excel to Dynamo.dyn (Dynamo 3.1.0.3411)
# author: Dynamo Team
# Un gráfico de ejemplo que muestra cómo importar datos procedentes de Excel a Dynamo.

# group: Entradas iniciales
# note: Vaya a la ruta del archivo de Excel .xlsx desde la que cargar los datos.
file_path = Filename("..\..\Data\helix.xlsx")
# note: Obtener el archivo de la ruta de archivo
fromPath = FileObject(path=file_path)  # "File.FromPath"
# note: El nombre de la hoja de cálculo de Excel que contiene los datos que se desean importar
string = StringInput("helix")

# group: Importar datos de Excel
# note: Este nodo puede leer datos procedentes de una hoja de cálculo de Excel. Leerá de todas las columnas y filas, cuyos datos resultantes estarán incluidos en una matriz doble [][] (matriz).
importExcel = Data.ImportExcel(file=fromPath, sheetName=string)

# group: Transponer
# note: Voltear (transponer) la lista (la matriz). Las columnas se convierten en filas y las filas en columnas.
transpose = List.Transpose(lists=importExcel)

# group: Extraer las coordenadas de los puntos
number = DoubleInput(0)
# note: Coordenada X
getItemAtIndex = List.GetItemAtIndex(list=transpose, index=number)
number_2 = DoubleInput(1)
# note: Coordenada Y
getItemAtIndex_2 = List.GetItemAtIndex(list=transpose, index=number_2)
number_3 = DoubleInput(2)
# note: Coordenada Z
getItemAtIndex_3 = List.GetItemAtIndex(list=transpose, index=number_3)

# group: Crear la hélice en función de los datos extraídos de Excel
byCoordinates = Point.ByCoordinates(x=getItemAtIndex, y=getItemAtIndex_2, z=getItemAtIndex_3, lacing=Longest)
