# Dynamo graph OpenXMLExport_Data To Excel.dyn (Dynamo 3.0.3.7594)
# author: Dynamo Team
# Un gráfico de ejemplo de Dynamo que muestra cómo exportar datos a Excel.

# group: Entradas iniciales
# note: Controla el número de puntos. Considérelo como la "altura" de la hélice.
number_slider = DoubleSlider(1.7, range=0..5 step 0.1)

# group: Crear la hélice
# note: Cree una serie de números, empezando por 0. El incremento es de 10. El número de puntos se multiplica por 360, por lo que si la entrada "numCircles" es 1, el resultado son 37 números (de 0 a 360) y obtendremos una revolución completa de la hélice.
code_block = CodeBlock(numCircles=number_slider) { 0..(360*numCircles)..10; }
# note: Función de coseno
cos = Math.Cos(angle=code_block, lacing=Longest)
# note: Función de seno
sin = Math.Sin(angle=code_block, lacing=Longest)
# note: Dividir por 100
code_block_2 = CodeBlock(x=code_block) { x/100; }
# note: Crear una lista de puntos; el componente X es el coseno, el Y es el seno y el Z es el valor inicial dividido por 100
byCoordinates = Point.ByCoordinates(x=cos, y=sin, z=code_block_2, lacing=Longest)
# note: Cree una estructura de lista a partir de la lista de puntos; el resultado es una lista que contiene tres listas ([][] - matriz doble), cada una de las cuales contiene la coordenada del punto X, Y y Z respectivamente.
code_block_3 = CodeBlock(pt=byCoordinates) { [pt.X,pt.Y,pt.Z]; }

# group: Crear las entradas para la exportación
# 1. La ruta al archivo csv
# 2. El nombre de la hoja de cálculo
# 3. La lista transpuesta de puntos
# 4. El índice inicial de la fila y la columna en Excel
# note: La ruta al archivo xlsx
file_path = Filename("..\..\Data\icosohedron_points.xlsx")
# note: El nombre de la hoja de cálculo de Excel
string = StringInput("helix")
# note: Voltear la matriz (transponer la lista). Las columnas se convierten en filas y las filas en columnas.
transpose = List.Transpose(lists=code_block_3)
# note: El número de columnas o filas para iniciar el registro de datos en Excel
number = DoubleInput(0)

# group: Exportar datos a un archivo de Excel
# note: Exporta datos a Excel
openXMLExportExcel = Data.OpenXMLExportExcel(filePath=file_path, sheetName=string, data=transpose, startRow=number, startColumn=number)
