# Dynamo graph OpenXMLImport_Data From Excel.dyn (Dynamo 3.1.0.3411)
# author: Dynamo Team
# Un gráfico de ejemplo que muestra cómo importar datos desde un archivo de Excel.

# group: Entradas iniciales
# 1. La ruta al archivo de Excel
# 2. El nombre de la hoja de cálculo
file_path = Filename("..\..\Data\helix.xlsx")
string = StringInput("helix")

# group: Extrae datos de Excel
# note: Leer datos de Excel
openXMLImportExcel = Data.OpenXMLImportExcel(filePath=file_path, sheetName=string)

# group: Analizar los datos de Excel
# El "análisis" de datos es el proceso de manipular un origen de datos de forma que se convierta en nativo para el entorno antes de utilizarlo.
# note: Transponer la lista (voltear la matriz). Las columnas se convertirán en filas y las filas en columnas.
transpose = List.Transpose(lists=openXMLImportExcel)
# note: Primera lista
number = DoubleInput(0)
# note: Segunda lista
number_2 = DoubleInput(1)
# note: Tercera lista
number_3 = DoubleInput(2)

# group: Crear la hélice
# note: Coordenada X
getItemAtIndex = List.GetItemAtIndex(list=transpose, index=number)
# note: Coordenada Y
getItemAtIndex_2 = List.GetItemAtIndex(list=transpose, index=number_2)
# note: Coordenada Z
getItemAtIndex_3 = List.GetItemAtIndex(list=transpose, index=number_3)
byCoordinates = Point.ByCoordinates(x=getItemAtIndex, y=getItemAtIndex_2, z=getItemAtIndex_3, lacing=Longest)
