# Dynamo graph Basics_Basic01.dyn "Basics_DeBase01" (Dynamo 2.19.3.6543)
# author: Dynamo Team
# Connecter les noeuds pour additionner deux nombres

# note: Les entrées fonctionnelles de base, telles que les numéros et les chaînes, peuvent être sélectionnées en navigant ou en effectuant une recherche à partir de la bibliothèque, sur la gauche du canevas.
# Les opérations exécutables sur les données, telles que les transformations mathématiques ou géométriques, sont également disponibles dans la bibliothèque
# note: Dynamo est un langage de programmation visuelle. Comme les autres langages, il permet de lier des éléments simples pour former des idées plus complexes
# note: Prenez un connecteur du port ">" sur le noeud Number et connectez-le au port "y" sur le noeud +, puis appuyez sur bouton Exécuter situé dans le coin inférieur gauche de l'application.
number = DoubleInput(2)  # graph input
add = number + _  # unwired: y
# note: Vous pouvez visualiser les données en cliquant sur le bouton Exécuter dans le coin inférieur droit de l'application. Si vous activez le mode d'exécution automatique, l'application est mise à jour en continu.
# Vous pouvez afficher les données en utilisant un noeud Watch ou en cliquant sur le petit carré dans la partie inférieure de la plupart des noeuds.
watch = Watch(add)
# note: Le menu d'aide contient des exemples de fichiers supplémentaires. Vous pouvez également fermer ce fichier en cliquant sur le symbole "X" dans l'onglet pour revenir à la page d'accueil
number_2 = DoubleInput(6)  # graph input
