# Dynamo graph Basics_Basic02.dyn "Basics_DeBase02" (Dynamo 2.19.3.6543)
# author: Dynamo Team
# Créer une ligne en connectant deux points

# note: Manipuler la position du point dans l'environnement Dynamo : sélectionner le noeud Point.ByCoordinates et passez à l'aperçu en arrière-plan pour tirer le point le long de ses trois axes.
byCoordinates = Point.ByCoordinates()
# note: Les données géométriques peuvent être affichées comme des informations textuelles ou dans un espace 3D
watch = Watch(byCoordinates)
number = DoubleInput(2)  # graph input
# note: Utilisez un noeud Number Slider ou Integer Slider pour saisir une valeur dans un intervalle spécifié de manière dynamique. Cliquez sur la flèche bleue de la liste déroulante pour ouvrir les paramètres d'intervalle numérique.
number_slider = DoubleSlider(4.43, range=0..10 step 0.1)  # graph input
# note: Vous pouvez basculer entre la navigation Arrière-plan 3D et la navigation Vue graphique en utilisant les boutons dans le coin supérieur droit de l'écran (raccourci Ctrl + B). Aperçu en arrière-plan peut également être activé et désactivé dans le menu Afficher pour Dynamo et Revit.
byCoordinates_2 = Point.ByCoordinates(x=number, z=number_slider)
byStartPointEndPoint = Line.ByStartPointEndPoint(startPoint=byCoordinates_2, endPoint=byCoordinates)
# note: Utiliser le noeud Watch 3D pour visualiser l'élément 3D de manière isolée
watch_3d = Watch3D(byStartPointEndPoint)
