# Dynamo graph Basics_Basic03.dyn (Dynamo 2.19.3.6543)
# author: Dynamo Team
# Créer une liste simple

# group: Entrées
# note: Les listes de données peuvent être générées avec des séquences et des intervalles. Ces listes peuvent être réorganisées avec de nombreux autres noeuds à des fins spécifiques
number = DoubleInput(0)  # graph input
number_2 = DoubleInput(9)  # graph input
number_3 = DoubleInput(1)  # graph input

# note: Créez une séquence de numéros, de Start à End, avec un noeud Step donné
range = Range(start=number, end=number_2, step=number_3, lacing=Longest)
watch = Watch(range)
number_4 = DoubleInput(3)  # graph input
# note: Sectionner la liste en longueurs de 3
chop = List.Chop(list=range, lengths=number_4)
# note: Afficher un aperçu du résultat et observer la structure de la liste à l'aide d'un noeud Watch
watch_2 = Watch(chop)
# note: Obtenir le dernier élément d'une liste
lastItem = List.LastItem(list=range)
watch_3 = Watch(lastItem)
