# Dynamo graph Core_AttractorPoint.dyn (Dynamo 3.0.0.6964)
# author: Dynamo Team
# Ce graphique crée une grille de cylindres, dans laquelle les tailles sont déterminées par la position d'un point d'attraction.

# group: Informations
# note: POINT D'ATTRACTION
# Un point d'attraction est un point de référence (ou élément) qui influence les caractéristiques des autres éléments d'un système. Un point d'attraction fonctionne souvent comme un aimant : plus l'élément est proche du point d'attraction, plus il est affecté par son influence.
# Dans cet exemple, la hauteur et le diamètre des cylindres sont déterminés par la distance entre chaque cylindre et le point d'attraction qui se déplace autour d'eux. Les cylindres autour du point d'attraction sont plus petits que ceux qui sont plus éloignés.
# Pour visualiser ce comportement, déplacez les deux curseurs numériques de l'entrée Attractor point.
# Les points d'attraction permettent d'introduire un niveau de réactivité et un comportement dynamique dans le processus de conception.

# group: Taille de grille de points
# note: Utilisez un Code Block pour créer une séquence de nombres. Dans ce cas, une séquence est créée avec des nombres allant de 1 à 50, avec n étapes, où chaque étape correspond à un intervalle de 5
intervalle_de_nombres = CodeBlock { 1..50..5; }

# group: Créer une grille de points
# note: Grille de points.
# Pour la créer, passez une série de nombres dans deux ports (coordonnées X et Y). Cliquez avec le bouton droit de la souris sur le noeud et définissez le paramètre Combinaison sur "Produit cartésien".
# note: La combinaison de produits cartésiens d'un noeud combine chaque élément d'une liste avec chaque élément d'une autre liste, ce qui donne une structure de listes semblable à une grille.
# Lorsqu'elle est utilisée avec les entrées X et Y du noeud Point.ByCoordinates, le résultat obtenu est une grille de points plate. Si la troisième coordonnée Z est utilisée, le résultat obtenu est une grille de points en forme de cube.
byCoordinates = Point.ByCoordinates(x=intervalle_de_nombres, y=intervalle_de_nombres, lacing=CrossProduct)

# group: Aplanir la structure de liste
# Une structure de liste complexe n'est pas requise pour d'autres actions avec les points. Utilisez Flatten pour générer une seule liste.
# note: Aplanissez la liste car la hiérarchie des lignes et des colonnes n'est pas nécessaire. Comparez l'entrée de ce noeud avec la sortie. La structure de N listes a été modifiée en une seule liste.
flatten = List.Flatten(list=byCoordinates)

# group: Position du point d'attraction
number_slider = DoubleSlider(24.6, range=-10..60 step 0.1)  # graph input
number_slider_2 = DoubleSlider(11.50111001, range=-10..60 step 0.1)  # graph input
# note: Point d'attraction. Déplacez les curseurs d'entrée pour ajuster l'emplacement de ce point.
byCoordinates_2 = Point.ByCoordinates(x=number_slider, y=number_slider_2)

# group: Distance par rapport au point d'attraction
# note: Détermine la distance entre le point d'attraction et chaque point de base des cylindres
distanceTo = Geometry.DistanceTo(geometry=flatten, other=byCoordinates_2)

# group: Générer des rayons et des hauteurs
# note: Formule permettant de faire en sorte que la hauteur des cylindres réagisse à l'emplacement du point d'attraction. Dans cet exemple, la hauteur de chaque cylindre correspond à la moitié de la distance par rapport au point d'attraction. Essayez une autre formule.
hauteur_de_cylindre = CodeBlock(x=distanceTo) { x/2; }
# note: Une formule renvoie une valeur à utiliser comme rayon du cylindre. Plus la distance est longue, plus le rayon de chaque cylindre est grand. Essayez d'utiliser une autre formule.
rayon_de_cylindre = CodeBlock(x=distanceTo) { x/15; }

# group: Points de fin
# Translater le point de départ (d'origine) de chaque cylindre avec une hauteur donnée, définie par la formule
# note: Vecteur de déplacement du point de base (d'origine) vers le haut selon une valeur donnée
byCoordinates_3 = Vector.ByCoordinates(z=hauteur_de_cylindre)
# note: Ajoutez cette nouvelle valeur Z (hauteur) aux points de grille d'origine pour obtenir les points supérieurs des cylindres.
add = Point.Add(point=flatten, vectorToAdd=byCoordinates_3)

# group: Créer des cylindres
# note: Utiliser une méthode qui crée un cylindre avec un point de départ, un point d'arrivée et un rayon donné
byPointsRadius = Cylinder.ByPointsRadius(startPoint=flatten, endPoint=add, radius=rayon_de_cylindre)
