# Dynamo graph Core_CodeBlocks.dyn (Dynamo 3.4.1.7055)
# author: Dynamo Team
# Ce graphique explore différentes utilisations et applications des Code Blocks

# group: Informations
# note: CODE BLOCKS
# Les Code Blocks peuvent être créés en cliquant deux fois dans la zone de dessin. Un Code Block se trouve également dans la bibliothèque de noeuds sous Script > catégorie Editor.
# Les Code Blocks peuvent contenir :
# •   Valeurs numériques (nombres entiers et nombres à virgule flottante)
# •  Chaînes (texte)
# •  Valeurs booléennes (True ou False)
# •  Listes [0,1,2]
# •  Expressions (a+3)
# •  Variables
# Les autres noeuds peuvent être transformés en une expression de Block Code : sélectionnez un ou plusieurs noeuds et cliquez avec le bouton droit de la souris sur l'espace entre les noeuds pour sélectionner "Noeud en code". Il n'existe pas de fonction inverse équivalente à cette action : les Code Blocks ne peuvent pas être transformés automatiquement en noeuds.

# group: Noeuds comme Code Blocks
# note: Les Code Blocks peuvent être utilisés pour appeler n'importe quel autre noeud de la bibliothèque. Les noeuds de la bibliothèque relèvent généralement de trois types
#     Création :	créer quelque chose
#     Action :	effectuer une action sur quelque		chose
#     Requête :	obtenir une propriété
# 		d'un élément existant
# Les méthodes ou noeuds de ces trois types sont traités différemment lorsqu'ils sont appelés dans un Code Block.

# group: Création de géométrie
# note: Ensemble, ces instructions forment un algorithme qui crée une courbe hélicoïdale au niveau d'un point de base.
code_block = CodeBlock()
# ---------- code_block.designscript (16 lines) ----------
// Basic inputs
base = Point.ByCoordinates(3,3);
coils = 3;
height = 5;
rad = 0.5;

// Make a series of points
numPts = 8*coils + 1;
seq = 0..(coils*360)..#numPts;
x = rad * Math.Cos(seq);
y = rad * Math.Sin(seq);
z = 0..height..#numPts;
pts = Point.ByCoordinates(x + base.X, y + base.Y, z + base.Z);

// Pass a curve through those points
NurbsCurve.ByPoints(pts);
# ----------------------------------------
# note: L'algorithme d'hélice est transformé en fonction en lui attribuant un nom, en spécifiant les entrées et en lui indiquant ce qu'elle doit renvoyer.
code_block_2 = CodeBlock()
# ---------- code_block_2.designscript (13 lines) ----------
def MakeSpring(base,coils,height,rad)
{
// Make a series of points
numPts = 8*coils + 1;
seq = 0..(coils*360)..#numPts;
x = rad * Math.Cos(seq);
y = rad * Math.Sin(seq);
z = 0..height..#numPts;
pts = Point.ByCoordinates(x + base.X, y + base.Y, z + base.Z);

// Return the curve that passes through those points
return = NurbsCurve.ByPoints(pts);
};
# ----------------------------------------
code_block_3 = CodeBlock { 0..6..2; }
code_block_4 = CodeBlock { 10..20..2; }
# note: L'algorithme d'hélice est transformé pour définir une fonction avec le nom arbitraire "MakeSpring". Cette fonction est appelée pour créer plusieurs ressorts, avec des hauteurs aléatoires, organisées dans une grille.
# note: crée une grille
byCoordinates = Point.ByCoordinates(x=code_block_3, y=code_block_4, lacing=CrossProduct)
flatten = List.Flatten(list=byCoordinates)
code_block_5 = CodeBlock { 5; }
count = List.Count(list=flatten)
# note: crée une série de nombres aléatoires (par incrément de 5) pour les hauteurs des ressorts
randomList = Math.RandomList(amount=count)
code_block_6 = CodeBlock(random=randomList) { random * 5; }
# note: Il est possible d'effectuer les entrées des appels de fonction avec des listes de choses ou d'éléments à valeur unique. Les données peuvent être transmises via un port ou déclarées directement, comme dans le cas de "0.5" pour les rayons de tous les ressorts.
code_block_7 = CodeBlock(basePoints=flatten, numCoils=code_block_5, height=code_block_6) { MakeSpring(basePoints,numCoils,height,0.5); }

# group: Fonctions
# note: Les fonctions peuvent être définies directement dans un noeud Bode Block pour être appelées ailleurs dans cette définition.
# La première ligne contient le mot-clé "def", puis le nom de la fonction, puis les valeurs entre parenthèses.
# Des accolades définissent le corps de la fonction. Chaque ligne doit se terminer par un point-virgule.
# Renvoyez une valeur avec "return =".
code_block_8 = CodeBlock()
# ---------- code_block_8.designscript (11 lines) ----------
/* This is a multi-line comment,
     which continues for mulitple
     lines. */

def FunctionName(input1, input2)
{
// This is a comment
sum = input1 + input2;

return = sum;
};
# ----------------------------------------
code_block_9 = CodeBlock { 1; }
# note: Les noeuds Code Block qui définissent une fonction ne disposent pas de ports d'entrée ou de sortie, car ils sont appelés à partir d'autres noeuds Code Block.
code_block_10 = CodeBlock { 2; }
# note: Appelez la fonction avec un autre noeud Code Block dans le même fichier en donnant le même nom et le même nombre d'arguments.
code_block_11 = CodeBlock(in1=code_block_9, in2=code_block_10) { FunctionName(in1,in2); }
watch = Watch(code_block_11)
code_block_12 = CodeBlock { "cat"; }
code_block_13 = CodeBlock { "dog"; }
# note: Le type des arguments d'entrée n'est pas spécifié dans la définition de la fonction, de sorte qu'elle fonctionne indépendamment de l'argument reçu.
code_block_14 = CodeBlock(in1=code_block_12, in2=code_block_13) { FunctionName(in1,in2); }
watch_2 = Watch(code_block_14)
origin = Point.Origin()
code_block_15 = CodeBlock { 16; }
# note: Un appel de fonction avec des entrées qui n'ont pas de signification pour cette fonction donne un résultat nul.
code_block_16 = CodeBlock(in1=origin, in2=code_block_15) { FunctionName(in1,in2); }
watch_3 = Watch(code_block_16)

# group: Valeurs numériques
# Comparer les noeuds spécialement conçus avec le Code Block
# note: Spécialement conçu
number = DoubleInput(3.14)
résultat = Watch(number)
# note: Code Block
code_block_17 = CodeBlock { 3.140; }
watch_4 = Watch(code_block_17)

# group: Valeurs de chaîne
# Comparez les noeuds spécialement conçus avec le Code Block
# note: Spécialement conçu
string = StringInput("Less is more.")
résultat_2 = Watch(string)
# note: Utilisez les guillemets "" pour créer une chaîne avec un noeud Code Block
code_block_18 = CodeBlock { "Less is more."; }
watch_5 = Watch(code_block_18)
# note: Utiliser ce noeud pour afficher le type de valeur de sortie
type = Object.Type(object=code_block_18)
watch_6 = Watch(type)

# group: Expressions
# Effectuer une opération de multiplication à l'aide d'un noeud * spécialement conçu et de Code Block
number_2 = DoubleInput(3)
number_3 = DoubleInput(5)
# note: Multiplier deux nombres à l'aide d'un noeud *
mul = number_2 * number_3
résultat_3 = Watch(mul)
# note: Effectuer une multiplication à l'aide d'un Code Block
code_block_19 = CodeBlock { 3*5; }
watch_7 = Watch(code_block_19)
code_block_20 = CodeBlock { 3; }
code_block_21 = CodeBlock { 5; }
# note: Utilisez des variables comme entrées pour l'opération de multiplication.
code_block_22 = CodeBlock(a=code_block_20, b=code_block_21) { a*b; }
watch_8 = Watch(code_block_22)

# group: Requête
# Méthodes qui interrogent et renvoient une propriété d'un objet
# note: Les Code Blocks permettent à l'utilisateur de choisir la méthode de spécification des entrées. Voici différentes façons de créer le même point, par exemple.
code_block_23 = CodeBlock { 10; }
code_block_24 = CodeBlock { -10; }
# note: Méthode prête à l'emploi utilisant le noeud Point.ByCoordinates
byCoordinates_2 = Point.ByCoordinates(x=code_block_23, y=code_block_24)
watch_9 = Watch(byCoordinates_2)
# note: Code Block utilise une méthode Point.ByCoordinates avec trois variables pour X, Y et Z, où le point Z est défini dans le même Code Block et séparé par un point virgule (;)
code_block_25 = CodeBlock(x=code_block_23, y=code_block_24) { z = 0; Point.ByCoordinates(x,y,z); }
watch_10 = Watch(code_block_25.out1)
code_block_26 = CodeBlock { Point.ByCoordinates(10,0,0); }
# note: Un Code Block équivaut à la même méthode. Les méthodes de requête ne nécessitent pas de parenthèses
code_block_27 = CodeBlock(pt=code_block_26) { pt.X; }
watch_11 = Watch(code_block_27)
# note: Méthode de requête prête à l'emploi qui renvoie la coordonnée X du point
X = Point.X(point=code_block_26)
watch_12 = Watch(X)
# note: Une formule d'utilisation d'une valeur négative correspondant à la même valeur numérique indiquée ici est intégrée dans la notation des variables d'entrée
code_block_28 = CodeBlock(num=code_block_23) { Point.ByCoordinates(num,-num,0); }
watch_13 = Watch(code_block_28)
# note: Le Code Block utilise une méthode Point.ByCoordinates, avec les trois variables fournies en entrée
code_block_29 = CodeBlock { Point.ByCoordinates(10,-10,0); }
watch_14 = Watch(code_block_29)

# group: Créer
# Méthodes de création de géométries, de listes, d'éléments Revit ou d'autres objets
# note: Méthode prête à l'emploi de création d'un point à l'origine
origin_2 = Point.Origin()
watch_15 = Watch(origin_2)
# note: Bien que cette méthode ne nécessite aucune entrée, des parenthèses sont requises
code_block_30 = CodeBlock { Point.Origin(); }
watch_16 = Watch(code_block_30)
code_block_31 = CodeBlock { 0; -10; }
# note: Méthode prête à l'emploi de création d'un point en spécifiant les coordonnées X et Y
byCoordinates_3 = Point.ByCoordinates(x=code_block_31.out0, y=code_block_31.out1)
watch_17 = Watch(byCoordinates_3)
# note: Utilisez un Code Block pour répliquer le comportement du noeud Point.ByCoordinates. Vous trouverez le nom de la méthode si vous passez le curseur de la souris sur le noeud prêt à l'emploi d'origine : la méthode est mentionnée dans la partie inférieure de la fenêtre d'info-bulle.
# Les entrées doivent être spécifiées dans l'ordre indiqué dans le noeud prêt à l'emploi.
code_block_32 = CodeBlock { Point.ByCoordinates(0,-10); }
watch_18 = Watch(code_block_32)

# group: Action
# Méthodes qui exécutent une action sur un objet
origin_3 = Point.Origin()
ZAxis = Vector.ZAxis()
# note: Méthode prête à l'emploi d'ajout d'un vecteur à un point
add = Point.Add(point=origin_3, vectorToAdd=ZAxis)
watch_19 = Watch(add)
origin_4 = Point.Origin()
ZAxis_2 = Vector.ZAxis()
# note: Les méthodes Action sont appliquées à un objet. Utilisez la notation par points après l'objet lui-même puis spécifiez la méthode et toutes les entrées disponibles dans le noeud prêt à l'emploi, à l'exception de la première (puisque le premier port d'entrée est l'objet lui-même, que vous avez déjà !)
code_block_33 = CodeBlock(pt=origin_4, vector=ZAxis_2) { pt.Add(vector); }
watch_20 = Watch(code_block_33)

# group: Créer des listes
# note: Créez une liste à l'aide de crochets pour définir la liste et de virgules pour séparer les éléments individuels
code_block_34 = CodeBlock { ["San Francisco","New York","Chicago"]; }
watch_21 = Watch(code_block_34)
# note: Obtenez des éléments d'une liste en utilisant la notation suivante : list [ i ], où i correspond à l'index de l'élément. Cette méthode équivaut à utiliser le noeud GetItemAtIndex
code_block_35 = CodeBlock(cities=watch_21) { cities[2]; }
watch_22 = Watch(code_block_35)
# note: Plusieurs variables sont définies dans ce bloc de code et. à la fin, une liste les contenant tous est créée.
code_block_36 = CodeBlock()
# ---------- code_block_36.designscript (7 lines) ----------
str0 = "alpha";
str1 = "beta";
str2 = "charlie";
str3 = "delta";
str4 = "echo";
//
[str0,str1,str2,str3,str4];
# ----------------------------------------
watch_23 = Watch(code_block_36.out5)
code_block_37 = CodeBlock(phonetic=watch_23) { phonetic[2..3]; }
watch_24 = Watch(code_block_37)
code_block_38 = CodeBlock { 2; }
getItemAtIndex = List.GetItemAtIndex(list=watch_21, index=code_block_38)
watch_25 = Watch(getItemAtIndex)

# group: Combiner les listes et accéder aux éléments de liste
# note: Créez des listes imbriquées et obtenez des éléments de ces listes.
code_block_39 = CodeBlock()
# ---------- code_block_39.designscript (6 lines) ----------
kitchen = ["table","stove","sink","refrigerator"];
livingRoom = ["sofa","books"];
bedroom = ["bed","dirty clothes"];
bathroom = ["tooth brush"];
//
allMyStuff = [kitchen, livingRoom, bedroom, bathroom];
# ----------------------------------------
watch_26 = Watch(code_block_39.allMyStuff)
# note: Accéder au deuxième élément de la troisième liste (ou, en d'autres termes, accéder à l'élément dont l'index est "1" dans la liste dont l'index est "2")
code_block_40 = CodeBlock(list=watch_26) { list[2][1]; }
watch_27 = Watch(code_block_40)

# group: Réplication
# note: Les guides de réplication peuvent être utilisés pour indiquer que les listes doivent être combinées en tant que "Produit cartésien".
code_block_41 = CodeBlock { x_vals = 0..10; y_vals = -30..-40; }
code_block_42 = CodeBlock(x_vals=code_block_41.x_vals, y_vals=code_block_41.y_vals) { Point.ByCoordinates(x_vals, y_vals); }
code_block_43 = CodeBlock { x_vals = 0..10; y_vals = -15..-25; }
code_block_44 = CodeBlock(x_vals=code_block_43.x_vals, y_vals=code_block_43.y_vals) { Point.ByCoordinates(x_vals<1>, y_vals<2>); }
byCoordinates_4 = Point.ByCoordinates(x=code_block_41.x_vals, y=code_block_41.y_vals)
byCoordinates_5 = Point.ByCoordinates(x=code_block_43.x_vals, y=code_block_43.y_vals, lacing=CrossProduct)
# note: Les guides de réplication, qui utilisent des chevrons, utilisent deux ou trois séries unidimensionnelles, et assemblent
# les éléments pour générer une série à une, deux ou trois dimensions.
# note: Dans cet exemple, il existe 2 valeurs X et 5 valeurs Y. Les guides de réplication peuvent spécifier que la combinaison obtenue se compose de 2 listes de 5 points ou de 5 listes de 2 points.
code_block_45 = CodeBlock()
# ---------- code_block_45.designscript (5 lines) ----------
x_vals = 0..1;
y_vals = -3..-7;
//
Point.ByCoordinates(x_vals<1>, y_vals<2>);
Point.ByCoordinates(x_vals<2>, y_vals<1>);
# ----------------------------------------
watch_28 = Watch(code_block_45.out2)
watch_29 = Watch(code_block_45.out3)

# group: Valeur booléenne
# Comparer les noeuds spécialement conçus avec le Code Block
# note: Noeud de bascule booléenne
boolean = BoolSelector(true)
watch_30 = Watch(boolean)
# note: Utilisez les valeurs 'true' ou 'false' dans un Code Block pour obtenir le même résultat
code_block_46 = CodeBlock { true; }
watch_31 = Watch(code_block_46)
