# Dynamo graph Core_ListAtLevel.dyn (Dynamo 3.1.0.3411)
# author: Dynamo Team
# Nous explorons List@Level et la manière dont cet outil peut être utilisé pour obtenir les mêmes résultats que le noeud List.Map. Nous créons une série de panneaux pour présenter la façon dont List@Level fonctionne réellement.

# group: Informations
# note: Pour déterminer le niveau de la liste auquel vous devez travailler, consultez la partie inférieure de la bulle d'aperçu, ou repérez votre noeud et suivez les lignes vers le haut à partir de la notation List@Level.

# group: Informations
# Informations générales sur l'utilisation de List@Level
# note: LIST@LEVEL
# List@Level remplace la fonction List.Map en vous permettant de sélectionner directement le niveau de liste auquel vous voulez travailler.
# note: Pour changer le niveau de liste auquel vous voulez travailler, cliquez sur la flèche située en regard du port d'entrée de la liste et activez l'option "Utiliser des niveaux".
# Lorsque List@Level est activé pour la première fois sur un port d'entrée, la liste située au deuxième niveau le plus à l'intérieur (L2) est sélectionnée pour utilisation.

# group: Informations
# Fonctionnement de ce graphique
# note: Notre but est de créer des panneaux à l'intérieur de la grille. Pour ce faire, nous devons obtenir les points se trouvant au niveau des index 1 et 2 de chaque liste, dans le niveau situé le plus à l'intérieur. Cela peut être effectué facilement à l'aide de la fonction List@Level. Nous activons l'option "Conserver la structure de la liste" afin de conserver le regroupement des listes. Commençons par examiner un peu mieux la liste que nous avons créée avec la fonction Point.ByCoordinates pour déterminer le niveau de la liste à utiliser.

# group: Entrées
code_block = CodeBlock { 0..30..#8; 12..0..#4; }
# note: Dans cet exemple, nous créons une liste 3D contenant une série de points. Il existe huit listes au niveau L3, contenant chacune quatre autres listes (L2). Chacune des quatre listes contient quatre points (L1), soit un total de 128 points.
byCoordinates = Point.ByCoordinates(x=code_block.out0, y=code_block.out1, z=code_block.out1, lacing=CrossProduct)

# group: Remplacement de List.Map par List@Level
code_block_2 = CodeBlock { [1,2]; }
# note: Dans la version précédente de Dynamo, List.Map était utilisé pour obtenir les niveaux intérieurs de listes. Même si cette fonction permet d'obtenir le même résultat, elle ajoute davantage de noeuds à votre espace de travail. Nous utilisons ici List@Level pour récupérer les points intérieurs de la grille de manière plus efficace. Nous utiliserons ensuite ces points pour créer des panneaux.
# Nous avons également utilisé l'option "Conserver la structure de la liste" pour conserver les groupes de la liste initiale et éviter tout aplatissement. Si l'option "Conserver la structure de la liste" est désactivée, un seul objet NurbsSurface sera créé au lieu de huit.
getItemAtIndex = List.GetItemAtIndex(list=byCoordinates@@L2, index=code_block_2)
code_block_3 = CodeBlock { [1,2]; }
# note: Les listes se trouvent à des niveaux différents, L1 représentant le niveau le plus bas. Le nombre total d'éléments produits par ce noeud est de 64, comme illustré dans la partie inférieure droite.
getItemAtIndex_2 = List.GetItemAtIndex(index=code_block_3)  # unwired: list
# note: Nous vous indiquons ci-dessous la procédure équivalente avec List.Map, qui revient au même que d'utiliser List@Level, mais requiert des noeuds supplémentaires.
map = List.Map(f_x=getItemAtIndex_2)  # unwired: list
map_2 = List.Map(list=byCoordinates, f_x=map)

# group: Création d'une géométrie
# note: Avec les ensembles de points sélectionnés, nous pouvons à présent créer des panneaux.
byPoints = NurbsSurface.ByPoints(points=getItemAtIndex)
byBestFitThroughPoints = Line.ByBestFitThroughPoints(bestFitPoints=getItemAtIndex)

# group: Inspection d'une liste avec List@Level et Count
# note: Le noeud List.Count renvoie le nombre d'éléments présents dans chaque liste. En fonction du niveau sélectionné, différentes valeurs sont renvoyées. Essayez de modifier la valeur de L3 en cliquant sur les flèches en regard de ce niveau.
# note: Le niveau L3 contient huit listes comportant chacune quatre autres listes. Par conséquent, le fait de sélectionner L3 applique la fonction List.Count aux huit listes, ce qui nous donne huit valeurs "4".
count = List.Count(list=byCoordinates@L3)

# group: Utilisation de la fonction "Conserver la structure de la liste"
# note: Ce noeud renvoie le nombre d'éléments présents dans chaque liste au niveau L2. Par défaut, les résultats sont aplatis en une liste à une dimension.
count_2 = List.Count(list=byCoordinates@L2)
# note: Pour conserver la structure imbriquée des listes, sélectionnez l'option "Conserver la structure de la liste". "@@" indique comment conserver la structure de liste dans DesignScript.
count_3 = List.Count(list=byCoordinates@@L2)

# group: Inspection d'une liste avec List@Level et Flatten
# note: Toujours à titre d'exemple, vous pouvez facilement aplatir la structure imbriquée à des niveaux intérieurs des listes en combinant la fonction List@Level et le noeud Flatten. Essayez de changer le niveau qui sera aplati en cliquant sur les flèches situées en regard du champ à double flèche List@Level.
# note: Le fait de sélectionner L3 convertit les huit listes situées à ce niveau en tableau à une dimension. Cette opération aplatit toutes listes du niveau L3 et, les huit listes comportant chacune quatre éléments (qui sont également des listes), nous obtenons donc huit listes de 16 points.
flatten = List.Flatten(list=byCoordinates@L3)
