# Dynamo graph Core_ListLacing.dyn (Dynamo 3.1.0.3411)
# author: Dynamo Team
# Combinaison de listes : tous les modes de combinaison de listes sont présentés et expliqués dans ce graphique

# group: Informations
# note: ENTRELACEMENT DE LISTES
# L'entrelacement est la logique utilisée par un noeud Dynamo pour combiner des éléments à partir de différentes listes. Dans Dynamo, la plupart des noeuds vous permettent de choisir comment combiner les listes des informations en définissant le "comportement d'entrelacement".
# Dans chacun de ces exemples, il existe deux listes de points qui sont transférées dans le noeud Line.ByStartPointEndPoint. Le noeud qui crée la ligne doit décider du nombre de lignes à dessiner et entre quels jeux de points.
# Définissez le comportement d'entrelacement en cliquant avec le bouton droit de la souris sur un noeud qui dispose de plusieurs ports d'entrée et en choisissant "Entrelacement".

# group: Conseil
# note: Conseil: affichez l'index de l'élément sous forme de libellé dans l'aperçu en l'arrière-plan pour tous les noeuds qui constituent la géométrie. Cliquez avec le bouton droit de la souris et choisissez Afficher les libellés.

# group: Conseil
# note: Conseil: le comportement d'entrelacement d'un noeud est signalé sur le noeud avec le petit glyphe dans le coin inférieur droit.  Si vous ne voyez aucun glyphe, le noeud ne permet pas d'effectuer un entrelacement.

# group: Entrées
# note: Série plus longue (10 éléments)
code_block = CodeBlock { 0..9; }
code_block_2 = CodeBlock { 4; }
# note: Série plus courte (6 éléments)
code_block_3 = CodeBlock { 0..5; }
code_block_4 = CodeBlock { 0..9; }
code_block_5 = CodeBlock { -10; 4; }
code_block_6 = CodeBlock { 0..5; }
code_block_7 = CodeBlock { 0..9; }
code_block_8 = CodeBlock { 10; 4; }
code_block_9 = CodeBlock { 0..5; }

# group: Créer des points
# Créer deux jeux de points (10 x 6) à utiliser comme entrée pour Line.ByStartPointEndPoint
byCoordinates = Point.ByCoordinates(x=code_block, z=code_block_2)
byCoordinates_2 = Point.ByCoordinates(x=code_block_3)

# group: Combinaison la plus longue
# note: Entrelacement le plus long
# Les lignes dessinées sont aussi nombreuses que les éléments dans la liste la plus longue de points d'entrée. Lorsque le noeud manque de points dans la liste la plus courte, il crée autant de copies que nécessaires en fonction des éléments finaux de la liste la plus longue.
byStartPointEndPoint = Line.ByStartPointEndPoint(startPoint=byCoordinates, endPoint=byCoordinates_2, lacing=Longest)

# group: Créer des points
# Créer deux jeux de points (10 x 6) à utiliser comme entrée pour Line.ByStartPointEndPoint
byCoordinates_3 = Point.ByCoordinates(x=code_block_4, y=code_block_5.out0, z=code_block_5.out1)
byCoordinates_4 = Point.ByCoordinates(x=code_block_6, y=code_block_5.out0)

# group: Combinaison la plus courte
# note: Entrelacement le plus court
# Autant de lignes sont dessinées qu'il existe d'éléments dans la liste d'entrée la plus courte. Les points "restants" dans la liste sont ignorés.
byStartPointEndPoint_2 = Line.ByStartPointEndPoint(startPoint=byCoordinates_3, endPoint=byCoordinates_4)

# group: Créer des points
# Créer deux jeux de points (10 x 6) à utiliser comme entrée pour Line.ByStartPointEndPoint
byCoordinates_5 = Point.ByCoordinates(x=code_block_7, y=code_block_8.out0, z=code_block_8.out1)
byCoordinates_6 = Point.ByCoordinates(x=code_block_9, y=code_block_8.out0)

# group: Combinaison de produits cartésiens
# note: Combinaison de produits cartésiens
# Toutes les combinaisons possibles de paires sont effectuées. Pour 10 points dans la liste la plus longue et 6 dans la liste la plus courte, on obtient 10 x 6 = 60 lignes.
byStartPointEndPoint_3 = Line.ByStartPointEndPoint(startPoint=byCoordinates_5, endPoint=byCoordinates_6, lacing=CrossProduct)
# note: Les lignes obtenues seront stockées dans une liste imbriquée, soit 6 listes de 10 lignes ou 10 listes de 6 lignes, selon la liste spécifiée en premier.
watch = Watch(byStartPointEndPoint_3)
