# Dynamo graph Core_Math.dyn (Dynamo 3.4.1.7055)
# author: Dynamo Team
# Il s'agit d'une exploration détaillée des différentes fonctions et capacités mathématiques de Dynamo

# group: Informations
# note: MATH
# Vous pouvez réaliser des opérations mathématiques dans Dynamo en utilisant les noeuds des bibliothèques Math et Operators ou un Code Block.  Vous trouverez ci-dessous comment effectuer plusieurs opérations mathématiques de base avec chacune de ces trois méthodes.

# group: Opérateurs arithmétiques de base
# note: Opérateurs arithmétiques tels que
# +, -, *, /, %

# group: Opérateurs logiques de base
# note: Opérateurs de comparaison tels que
# <,>,<=,>=,! =, ==

# group: Opérateurs booléens
# note: Opérateurs booléens
# (rechercher les autres opérateurs dans la bibliothèque).

# group: Arrondi
# note: Arrondi

# group: Fonctions mathématiques complexes
# 4 exemples d'obtention du même résultat final à l'aide de noeuds, Python, Fo
# note: Cet exemple présente quatre manières différentes d'aborder les fonctions mathématiques.  Chacun de ces exemples commence par une grille de points, calcule les coordonnées z des points, puis crée une surface.  Seule la méthode de calcul diffère; ces méthodes reviennent toutes au même.
# 1. Noeuds. Les noeuds mathématiques sont situés dans la section Math de la bibliothèque, qui est en outre divisée en Fonctions, Logique et Opérateurs.
# 2. Python.
# 3. Noeud Code Block.  Double-cliquez n'importe où dans la zone de dessin pour créer un noeud Code Block.  La syntaxe de chaque fonction correspond au nom du noeud dans Dynamo.
# ** Remarque: vous pouvez ajuster la résolution de l'aperçu de la géométrie via les paramètres Précision du rendu: Dynamo -> Préférences -> Paramètres visuels -> Précision du rendu
# note: Pour plus d'informations sur cet exemple:
# http://dynamobim.org/math-transit/

# group: Arc
# note: Créer un arc à l'aide de deux méthodes distinctes, une utilisant des noeuds et l'autre des Code Blocks. Les résultats sont visualisés pour plus de clarté

# group: Conseil
# Mise en surbrillance des noeuds de géométrie
# note: Conseil: la sélection d'un noeud qui dessine la géométrie applique la couleur cyan à la géométrie. Ce Code Block dessine les axes d'un graphique, les points le long de la courbe et la courbe elle-même. Sélectionnez le Code Block pour voir quelle courbe il dessine dans l'arrière-plan.

# group: Courbe cosinus
# note: Cet ensemble d'exemples montre comment représenter de manière graphique une fonction cosinus à l'aide de noeuds et d'un Code Block.
# Chaque exemple prend en entrée une série de nombres comme valeurs x pour une série de points, calcule les valeurs y à partir des valeurs x, puis dessine une ligne en forme de courbe cosinus.  Le Code Block de grande taille à la fin de chaque graphique déplace la géométrie dessinée vers une autre partie de l'écran afin qu'elles ne se superposent pas.

# group: Conseil
# Précision du rendu
# note: Conseil: ajustez la précision du rendu de la géométrie dans l'aperçu en arrière-plan en accédant à Dynamo -> Préférences -> Paramètres visuels -> Précision du rendu.  Une valeur élevée permet de donner un aspect plus lisse aux surfaces courbes, mais le dessin nécessitera plus de puissance de traitement.

# group: noeuds > Saisie initiale de la liste de points
code_block = CodeBlock { -10..10..#20; }

# group: noeuds > Création et manipulation de la liste de points initiale
# note: Crée une grille de points.
# Notez que le comportement de combinaison est
# "produit cartésien".
byCoordinates = Point.ByCoordinates(x=code_block, y=code_block, lacing=CrossProduct)
flatten = List.Flatten(list=byCoordinates)
X = Point.X(point=flatten)
Y = Point.Y(point=flatten)

# group: noeuds > Amplitude
# note: Amplitude
number_slider = DoubleSlider(5.51, range=0..10 step 0.1)  # graph input

# group: noeuds > Carré
number = DoubleInput(2)  # graph input
pow = Math.Pow(number=X, power=number)

# group: noeuds > Carré
number_2 = DoubleInput(2)  # graph input
pow_2 = Math.Pow(number=Y, power=number_2)

# group: noeuds > Fréquence
# note: Fréquence
number_slider_2 = DoubleSlider(1.724, range=0..6 step 0.1)  # graph input

# group: noeuds > Carré
number_3 = DoubleInput(2)  # graph input
pow_3 = Math.Pow(number=number_slider_2, power=number_3)

# group: noeuds > Série de calculs et de manipulations mathématiques permettant de créer la géométrie "ride" à l'aide de noeuds
add = pow + pow_2
add_2 = add + pow_3
sqrt = Math.Sqrt(number=add_2)
# note: Dans Dynamo, les angles sont exprimés en degrés
radiansToDegrees = Math.RadiansToDegrees(radians=sqrt)
sin = Math.Sin(angle=radiansToDegrees)
div = sin / sqrt
mul = number_slider * div

# group: noeuds > Collecter les points obtenus et préparer le rendu final
byCoordinates_2 = Point.ByCoordinates(x=X, y=Y, z=mul)
# note: Comptabilise le nombre de groupes de points à partir de l'ensemble initial de points (20x20)
count = List.Count(list=byCoordinates)

# group: noeuds > Ensemble de points
# note: Divise une liste simple en une série
# de listes par ligne
chop = List.Chop(list=byCoordinates_2, lengths=count)

# group: noeuds > Réseau de courbes
# note: Crée des courbes NURBS
# via des points
byPoints = NurbsCurve.ByPoints(points=chop)

# group: noeuds > Surface finale
# note: Crée une surface
byLoft = Surface.ByLoft(crossSections=byPoints)

# group: Code Block > Saisie initiale de la liste de points
code_block_2 = CodeBlock { -10..10..#20; }

# group: Code Block > Création et manipulation de la liste de points initiale
byCoordinates_3 = Point.ByCoordinates(x=code_block_2, y=code_block_2, lacing=CrossProduct)
flatten_2 = List.Flatten(list=byCoordinates_3)
Y_2 = Point.Y(point=flatten_2)
X_2 = Point.X(point=flatten_2)

# group: Code Block > Fonction d'assistant pour le déplacement de la géométrie
# note: Déplace la géométrie sur
code_block_3 = CodeBlock(x=Y_2) { x+60; }

# group: Code Block > Fréquence
number_slider_3 = DoubleSlider(1.724, range=0..5 step 0.1)  # graph input

# group: Code Block > Amplitude
number_slider_4 = DoubleSlider(5.51, range=0..10 step 0.1)  # graph input

# group: Code Block > Série de calculs mathématiques et de manipulations permettant de créer la géométrie "ride" à l'aide de Python
# note: Les noms des méthodes mathématiques correspondent aux noms des noeuds Dynamo utilisés dans le premier exemple.
code_block_4 = CodeBlock(x=X_2, y=Y_2, c=number_slider_3, A=number_slider_4)
# ---------- code_block_4.designscript (6 lines) ----------
sum = Math.Pow(x,2) + Math.Pow(y,2) + Math.Pow(c,2);

num1 = Math.Sqrt(sum);
num2 = Math.Sin( Math.RadiansToDegrees(num1) );

A * num2 / num1;
# ----------------------------------------

# group: Code Block > Collecter les points obtenus et préparer le rendu final
byCoordinates_4 = Point.ByCoordinates(x=code_block_3, y=X_2, z=code_block_4.out3)
count_2 = List.Count(list=byCoordinates_3)

# group: Code Block > Ensemble de points
chop_2 = List.Chop(list=byCoordinates_4, lengths=count_2)

# group: Code Block > Réseau de courbes
byPoints_2 = NurbsCurve.ByPoints(points=chop_2)

# group: Code Block > Surface finale
byLoft_2 = Surface.ByLoft(crossSections=byPoints_2)

# group: Python > Saisie initiale de la liste de points
code_block_5 = CodeBlock { -10..10..#20; }

# group: Python > Création et manipulation de la liste de points initiale
byCoordinates_5 = Point.ByCoordinates(x=code_block_5, y=code_block_5, lacing=CrossProduct)
flatten_3 = List.Flatten(list=byCoordinates_5)
X_3 = Point.X(point=flatten_3)
Y_3 = Point.Y(point=flatten_3)

# group: Python > Fonction d'assistant pour le déplacement de la géométrie
# note: Déplace la géométrie sur
code_block_6 = CodeBlock(x=X_3) { x+30; }

# group: Python > Amplitude
number_slider_5 = DoubleSlider(5.51, range=0..10 step 0.1)  # graph input

# group: Python > Fréquence
number_slider_6 = DoubleSlider(1.724, range=0..5 step 0.1)  # graph input

# group: Python > Série de calculs mathématiques et de manipulations permettant de créer la géométrie "ride" à l'aide de Python
python_script = Python(Amplitude=number_slider_5, X=X_3, Y=Y_3, Frequency=number_slider_6)  # PythonNet3
# ---------- python_script.python (27 lines) ----------
import clr
clr.AddReference('ProtoGeometry')
from Autodesk.DesignScript.Geometry import *

import math

# The inputs to this node will be stored as a list in the IN variable.
amp = IN[0]   # single value
x = IN[1]     # list
y = IN[2]     # list (expect same length as x)
c = IN[3]     # single value

# Declare an empty array of z-values
z = []

# Solve the equation for each x and y value
for index in range(len(x)):
	sum = math.pow(x[index],2) + math.pow(y[index],2) + math.pow(c,2)
	num1 = math.sqrt(sum)
	num2 = math.sin(num1)
	zVal = amp * num2 / num1
	
	# Append the answer to the list of z values
	z.append(zVal)

# Assign the z-values to the OUT variable
OUT = z
# ----------------------------------------

# group: Python > Collecter les points obtenus et préparer le rendu final
byCoordinates_6 = Point.ByCoordinates(x=code_block_6, y=Y_3, z=python_script)
count_3 = List.Count(list=byCoordinates_5)

# group: Python > Ensemble de points
chop_3 = List.Chop(list=byCoordinates_6, lengths=count_3)

# group: Python > Réseau de courbes
byPoints_3 = NurbsCurve.ByPoints(points=chop_3)

# group: Python > Surface finale
byLoft_3 = Surface.ByLoft(crossSections=byPoints_3)

# group: Courbe cosinus utilisant des Code Blocks > Entrées
# note: Point de coordonnées de base
code_block_7 = CodeBlock { 25; 20; }
# note: Série de valeurs X
code_block_8 = CodeBlock { 0..10..#20; }
# note: Amplitude
number_slider_7 = DoubleSlider(3, range=0..10 step 0.1)  # graph input
# note: Fréquence
number_slider_8 = DoubleSlider(36, range=0..100 step 0.1)  # graph input

# group: Courbe cosinus utilisant des Code Blocks > Fonction de courbe cosinus
# Obtenir la valeur du cosinus pour la fréquence et l'angle donnés, puis multiplier cette valeur par l'amplitude
code_block_9 = CodeBlock(amplitude=number_slider_7, frequency=number_slider_8, angle=code_block_8) { amplitude * Math.Cos(frequency * angle); }

# group: Courbe cosinus utilisant des Code Blocks > Opérations intermédiaires
byCoordinates_7 = Point.ByCoordinates(x=code_block_7.out0, y=code_block_7.out1)
byCoordinates_8 = Point.ByCoordinates(x=code_block_8, y=code_block_9)

# group: Courbe cosinus utilisant des Code Blocks > Créer et visualiser la courbe cosinus
code_block_10 = CodeBlock(base=byCoordinates_7, pts=byCoordinates_8)
# ---------- code_block_10.designscript (14 lines) ----------
// Make axes from base point
dimension = 10;
top = Point.ByCoordinates(base.X, base.Y + dimension/2);
bottom = Point.ByCoordinates(base.X, base.Y - dimension/2);
right = Point.ByCoordinates(base.X + 10, base.Y);
Line.ByStartPointEndPoint(bottom, top);
Line.ByStartPointEndPoint(base, right);

// Move function results to base point
vec = base.AsVector();
newPts = pts.Add(vec);

// Draw a line through the points
NurbsCurve.ByPoints(newPts);
# ----------------------------------------

# group: Courbe cosinus utilisant des noeuds > Entrées
# note: Coordonnées x, y du point de base
code_block_11 = CodeBlock { -5; 20; }
# note: Série de valeurs X
code_block_12 = CodeBlock { 0..10..#20; }
# note: Fréquence
number_slider_9 = DoubleSlider(36, range=0..100 step 0.1)  # graph input

# group: Courbe cosinus utilisant des noeuds > Contrôle l'amplitude
# note: Amplitude
number_slider_10 = DoubleSlider(3, range=0..10 step 0.1)  # graph input

# group: Courbe cosinus utilisant des noeuds
mul_2 = number_slider_9 * code_block_12

# group: Courbe cosinus utilisant des noeuds > Fonction Math.Cos
# Obtenir la valeur du cosinus pour chaque nombre initial
cos = Math.Cos(angle=mul_2)

# group (continued): Courbe cosinus utilisant des noeuds
mul_3 = number_slider_10 * cos

# group: Courbe cosinus utilisant des noeuds > Opérations intermédiaires
byCoordinates_9 = Point.ByCoordinates(x=code_block_11.out0, y=code_block_11.out1)
# note: Conseil: vous pouvez activer ou désactiver la fonctionnalité d'aperçu pour tous les noeuds qui composent la géométrie. Cliquez avec le bouton droit de la souris et activez ou désactivez l'option Aperçu.
byCoordinates_10 = Point.ByCoordinates(x=code_block_12, y=mul_3)

# group: Courbe cosinus utilisant des noeuds > Créer et visualiser la courbe cosinus
code_block_13 = CodeBlock(base=byCoordinates_9, pts=byCoordinates_10)  # same code as code_block_10

# group: Arc utilisant des noeuds > Entrées
# Créer les entrées nécessaires :
# 1. Point de centre
# 2. Rayon
# 3. Angle de départ
# 4. Angle de fin
# 5. Normale (axe Z)
code_block_14 = CodeBlock { 0; 35; }
byCoordinates_11 = Point.ByCoordinates(x=code_block_14.out0, y=code_block_14.out1)
code_block_15 = CodeBlock { 5; 0; }
# note: Déplacez le curseur pour modifier la longueur de l'arc.
number_slider_11 = DoubleSlider(247.821, range=0..360 step 0.1)  # graph input
ZAxis = Vector.ZAxis()

# group: Arc utilisant des noeuds > Créer un arc selon un point de centre, un rayon et un angle
# note: Les angles dans les noeuds ou le Code Block sont exprimés en radians.
byCenterPointRadiusAngle = Arc.ByCenterPointRadiusAngle(center=byCoordinates_11, radius=code_block_15.out0, startAngle=code_block_15.out1, endAngle=number_slider_11, normal=ZAxis)

# group: Arc utilisant des noeuds > Visualiser les résultats
endPoint = Curve.EndPoint(curve=byCenterPointRadiusAngle)
byStartPointEndPoint = Line.ByStartPointEndPoint(startPoint=endPoint, endPoint=byCoordinates_11)
startPoint = Curve.StartPoint(curve=byCenterPointRadiusAngle)
byStartPointEndPoint_2 = Line.ByStartPointEndPoint(startPoint=startPoint, endPoint=byCoordinates_11)

# group: Opérations utilisant des noeuds > -
code_block_16 = CodeBlock { 5; 2; }
sub = code_block_16.out0 - code_block_16.out1
watch = Watch(sub)

# group: Opérations utilisant des Code Blocks > -
code_block_17 = CodeBlock { 5-2; }
watch_2 = Watch(code_block_17)

# group: Opérations utilisant des Code Blocks > %
code_block_18 = CodeBlock { 5%2; }
watch_3 = Watch(code_block_18)

# group: Opérations utilisant des noeuds > %
code_block_19 = CodeBlock { 5; 2; }
mod = code_block_19.out0 % code_block_19.out1
watch_4 = Watch(mod)

# group: Opérations utilisant des Code Blocks > <=
code_block_20 = CodeBlock { 5<=2; }
watch_5 = Watch(code_block_20)

# group: Opérations utilisant des Code Blocks > >
code_block_21 = CodeBlock { 5>2; }
watch_6 = Watch(code_block_21)

# group: Opérations utilisant des noeuds > <=
code_block_22 = CodeBlock { 5; 2; }
le = code_block_22.out0 <= code_block_22.out1
watch_7 = Watch(le)

# group: Opérations utilisant des noeuds > >
code_block_23 = CodeBlock { 5; 2; }
gt = code_block_23.out0 > code_block_23.out1
watch_8 = Watch(gt)

# group: Arc utilisant des Code Blocks > Entrées
# Créer les entrées nécessaires :
# 1. Point de centre
# 2. Angle de fin
code_block_24 = CodeBlock { 15; 35; }
byCoordinates_12 = Point.ByCoordinates(x=code_block_24.out0, y=code_block_24.out1)
number_slider_12 = DoubleSlider(126.947, range=0..360 step 0.1)  # graph input

# group: Arc utilisant des Code Blocks > Créer un arc selon un point de centre, un rayon et un angle
code_block_25 = CodeBlock(center=byCoordinates_12, endAngle=number_slider_12) { Arc.ByCenterPointRadiusAngle(center,5,0,endAngle,Vector.ZAxis()); }

# group: Arc utilisant des Code Blocks > Visualiser les résultats
startPoint_2 = Curve.StartPoint(curve=code_block_25)
byStartPointEndPoint_3 = Line.ByStartPointEndPoint(startPoint=startPoint_2, endPoint=byCoordinates_12)
endPoint_2 = Curve.EndPoint(curve=code_block_25)
byStartPointEndPoint_4 = Line.ByStartPointEndPoint(startPoint=endPoint_2, endPoint=byCoordinates_12)

# group: Arrondi utilisant des noeuds > Entrées
code_block_26 = CodeBlock { 3.14159; }
code_block_27 = CodeBlock { 3; }

# group: Arrondi utilisant des noeuds > Arrondir à la baisse
floor = Math.Floor(number=code_block_26)
watch_9 = Watch(floor)

# group: Arrondi utilisant des noeuds > Arrondir à la hausse
ceiling = Math.Ceiling(number=code_block_26)
watch_10 = Watch(ceiling)

# group: Arrondi utilisant des noeuds > Arrondir à la hausse ou à la baisse
# Selon ce qui est le plus proche
round = Math.Round(number=code_block_26)
watch_11 = Watch(round)

# group: Arrondi utilisant des noeuds > Arrondir à un nombre spécifié de chiffres
round_2 = Math.Round(number=code_block_26, digits=code_block_27)
watch_12 = Watch(round_2)

# group: Arrondi utilisant des Code Blocks > Entrées
code_block_28 = CodeBlock { 3.14159; }

# group: Arrondi utilisant des Code Blocks > Arrondir à la baisse
code_block_29 = CodeBlock(num=code_block_28) { Math.Floor(num); }
watch_13 = Watch(code_block_29)

# group: Arrondi utilisant des Code Blocks > Arrondir à la hausse
code_block_30 = CodeBlock(num=code_block_28) { Math.Ceiling(num); }
watch_14 = Watch(code_block_30)

# group: Arrondi utilisant des Code Blocks > Arrondir à la hausse ou à la baisse.
# Selon ce qui est le plus proche
code_block_31 = CodeBlock(num=code_block_28) { Math.Round(num); }
watch_15 = Watch(code_block_31)

# group: Arrondi utilisant des Code Blocks > Arrondir à un nombre spécifié de chiffres
code_block_32 = CodeBlock(num=code_block_28) { Math.Round(num,3); }
watch_16 = Watch(code_block_32)

# group: Opérations utilisant des Code Blocks > ==(égal)
code_block_33 = CodeBlock { true == false; }
watch_17 = Watch(code_block_33)

# group: Opérations utilisant des Code Blocks > Non
code_block_34 = CodeBlock { !true; }
watch_18 = Watch(code_block_34)

# group: Opérations utilisant des Code Blocks > && (et)
code_block_35 = CodeBlock { true && false; }
watch_19 = Watch(code_block_35)

# group: Opérations utilisant des Code Blocks > || (ou)
code_block_36 = CodeBlock { true || false; }
watch_20 = Watch(code_block_36)

# group: Opérations utilisant des noeuds > ==(égal)
boolean = BoolSelector(true)  # graph input
boolean_2 = BoolSelector(false)  # graph input
eq = boolean == boolean_2
watch_21 = Watch(eq)

# group: Opérations utilisant des noeuds > || (ou)
boolean_3 = BoolSelector(true)  # graph input
boolean_4 = BoolSelector(false)  # graph input
or_ = boolean_3 || boolean_4
watch_22 = Watch(or_)

# group: Opérations utilisant des noeuds > && (et)
boolean_5 = BoolSelector(true)  # graph input
boolean_6 = BoolSelector(false)  # graph input
and_ = boolean_5 && boolean_6
watch_23 = Watch(and_)

# group: Opérations utilisant des noeuds > Non
boolean_7 = BoolSelector(true)  # graph input
not_ = Not(x=boolean_7)
watch_24 = Watch(not_)
