# Dynamo graph Core_PassingFunctions.dyn (Dynamo 3.1.0.3411)
# author: Dynamo Team
# Démonstration du passage d'une fonction dans Dynamo

# group: Informations
# note: Transmission de fonctions
# Dynamo est un langage fonctionnel, ce qui signifie que les actions peuvent être traitées de la même façon que les objets. Dans Dynamo, la plupart des noeuds peuvent être activés dans une fonction et utilisés d'une manière très précise sur un jeu de données.
# Définir une fonction et transmettre une fonction revient à exécuter la commande "Exécuter pendant 20 minutes!" en spécifiant ultérieurement à qui vous vous adressez.
# Dans cet exemple, une grille de cercles est représentée dans une structure complexe. La commande de sélection d'un jeu de cercles est utilisée directement, puis la commande est transmise comme une fonction à la place aux niveaux inférieurs de données pour obtenir un résultat différent.

# group: Entrées initiales
# Créer une matrice de points 5x8
code_block = CodeBlock { 0..#8..4; }
code_block_2 = CodeBlock { 0..#5..4; }
byCoordinates = Point.ByCoordinates(x=code_block, y=code_block_2, lacing=CrossProduct)

# group: Dessiner une matrice de cercles
# note: Cette liste de points est organisée selon une structure hiérarchique. Il s'agit d'une liste de listes. La grille a été réalisée avec 8 points dans la direction X et 5 dans la direction Y. Cette liste représente 8 listes de 5 éléments ou des listes de colonnes de points.
watch = Watch(byCoordinates)
code_block_3 = CodeBlock { 1.5; }
# note: Dessiner un cercle autour de chaque point.
byCenterPointRadius = Circle.ByCenterPointRadius(centerPoint=watch, radius=code_block_3)

# group: Sélectionner la deuxième et la troisième LISTE
# Passage de la fonction
code_block_4 = CodeBlock { 1..2; }
# note: Dans la liste imbriquée de cercles, les éléments {1,2} sont sélectionnés. Les noeuds Dynamo agissent sur une liste "de l'extérieur vers l'intérieur" ou du niveau le plus élevé au niveau le plus bas.
# La sélection des éléments 1 et 2 dans la liste renvoie les listes 1 et 2 de la structure d'origine de listes imbriquées.
getItemAtIndex = List.GetItemAtIndex(list=byCenterPointRadius, index=code_block_4)

# group: Extruder vers le HAUT
# Cylindres obtenus
# note: Les données sélectionnées existent toujours dans la même structure où elles se trouvaient avant que je ne sélectionne le mappage.
watch_2 = Watch(getItemAtIndex)
code_block_5 = CodeBlock { 3; }
# note: Cette liste de cercles est extrudée vers le haut.
extrude = Curve.Extrude(curve=watch_2, distance=code_block_5)

# group: Sélectionner le deuxième et le troisième ELEMENT de CHAQUE LISTE
# Passage de la fonction
code_block_6 = CodeBlock { 1..2; }
# note: Plutôt que de choisir les deux premières listes à partir de la sortie du noeud, la fonction List@Level permet aux éléments 1 et 2 de CHAQUE liste d'être choisi, en sélectionnant L2 sur le port d'entrée de List.GetItemAtIndex.
# Notez que cette fonction résout la fonctionnalité de List.Map, une méthode utilisée pour accéder aux niveaux internes des listes d'entrée dans les précédentes versions de Dynamo.
getItemAtIndex_2 = List.GetItemAtIndex(list=byCenterPointRadius@L2, index=code_block_6)

# group: Extruder vers le BAS
# Cylindres obtenus
watch_3 = Watch(getItemAtIndex_2)
code_block_7 = CodeBlock { -3; }
# note: Cette liste de cercles est extrudée vers le bas.
extrude_2 = Curve.Extrude(curve=watch_3, distance=code_block_7)
