# Dynamo graph Core_Python.dyn (Dynamo 4.1.0.2940)
# author: Dynamo Team
# Utiliser le noeud Python dans Dynamo

# group: Informations
# note: PYTHON
# Dynamo prend en charge CPython via l'un des deux types de noeuds Python. (Un second type de noeud, non illustré ici, peut lire un script à partir d''un fichier externe à exécuter.)
# Cliquez deux fois sur le noeud Python pour afficher le script qu''il contient.
# L'entrée est contenue dans le réseau IN. La sortie doit être affectée à la variable OUT. La sortie peut être une valeur unique ou un réseau.

# group: Utiliser le noeud Python pour appliquer la manipulation de la signalisation à la liste
# note: Cet exemple permet d'ajouter ou de soustraire tous les éléments d'une liste. Ses entrées sont un nombre, dont le signe détermine si l'ajout ou la soustraction est utilisé(e), et une liste de nombres.

# group: Choisir un nombre positif, négatif ou 0
# note: Sélectionner le signe pour l'opération
#     nombre < 0      soustraire chaque
#     nombre = 0      0
#     nombre > 0      ajouter chaque
integer_slider = IntegerSlider(1, range=-1..2 step 1)

# group: Créer une liste d'entrée
# note: Créer une liste
code_block = CodeBlock { 0..10; }
watch = Watch(code_block)

# group: Python
# Applique la manipulation de la signalisation
# note: La sortie de OUT est un réseau dans lequel le premier élément est une valeur unique et le deuxième élément est une liste de valeurs. Cette structure de données a été spécifiée dans la définition de Python. La spécification d'un réseau vous permet d'envoyer un nombre quelconque de sorties dans le graphique Dynamo.
python_script = Python(Sign=integer_slider, List=watch)  # PythonNet3
# ---------- python_script.python (31 lines) ----------
# Python script to find add or subtract a series of numbers. 

# Boiler-plate import statments included out-of-the-box
import clr
clr.AddReference('ProtoGeometry')
from Autodesk.DesignScript.Geometry import *

# The inputs to this node will be stored as a list in the IN variable.
sign = IN[0]  # -1 for subtract all, 0 for do nothing, 1 for add all
nums = IN[1]  # List of numbers to subtract or add

partials = [] # Empty array to contain partial sums or differences
result = 0    # Initialize the sum or difference to 0

# Loop through each item and add it or subtract it from the result.
for index in range(len(nums)):
	if sign > 0:
		result = result + nums[index]
		partials.append(result)
	elif sign == 0:
		partials.append(result)
		continue
	else:
		result = result - nums[index]
		partials.append(result)

# Assign the output to the OUT variable
#OUT = results  # Use this to output only the result.
OUT = []
OUT.append(result)
OUT.append(partials)
# ----------------------------------------

# group: Liste obtenue
code_block_2 = CodeBlock { 1; }
getItemAtIndex = List.GetItemAtIndex(list=python_script, index=code_block_2)
# note: Série de résultats partiels.
watch_2 = Watch(getItemAtIndex)

# group: Somme obtenue
code_block_3 = CodeBlock { 0; }
getItemAtIndex_2 = List.GetItemAtIndex(list=python_script, index=code_block_3)
# note: Résultat total.
watch_3 = Watch(getItemAtIndex_2)

# group: Création de géométrie Python
# note: Cet exemple de Python n'a pas d'entrées. Il montre comment créer une géométrie à l'aide de la bibliothèque de protogéométries de Dynamo. Dans la mesure où le noeud Python crée une géométrie visible, le fait de le sélectionner, exactement comme n'importe quel autre noeud, entraînera la mise en surbrillance de la géométrie.
python_script_2 = Python()  # PythonNet3
# ---------- python_script_2.python (24 lines) ----------
import clr
clr.AddReference('ProtoGeometry')
from Autodesk.DesignScript.Geometry import *
#The inputs to this node will be stored as a list in the IN variable.
dataEnteringNode = IN

p1 = Point.ByCoordinates(0, 0, 0);
p2 = Point.ByCoordinates(-10, -10, -10);

l = Line.ByStartPointEndPoint(p1, p2);

pts = [
	Point.ByCoordinates(0, 0, 0),
	Point.ByCoordinates(10, 10, 0),
	Point.ByCoordinates(20, 0, 0),
	Point.ByCoordinates(30, 10, 0),
	Point.ByCoordinates(40, 0, 0) ]
	
spline = NurbsCurve.ByPoints(pts)

surf = spline.Extrude(Vector.ByCoordinates(0, 0, 1), 10)

#Assign your output to the OUT variable
OUT = [l, spline, surf]
# ----------------------------------------

# group: Examiner les résultats obtenus
# note: Conseil: utilisez un Code Block
# pour accéder à certains éléments dans une liste.
code_block_4 = CodeBlock(output=python_script_2) { output[0]; output[1]; output[2]; }
watch_4 = Watch(code_block_4.out2)
watch_5 = Watch(code_block_4.out0)
watch_6 = Watch(code_block_4.out1)
