# Dynamo graph Core_RangeSyntax.dyn (Dynamo 3.0.0.6964)
# author: Dynamo Team
# Ce graphique présente plusieurs manières de générer des séries de nombres ou de caractères avec des espacements réguliers.

# group: Informations
# note: Syntaxe d'intervalle
# Il existe plusieurs manières de créer des listes sous forme de séquences de nombres ou de caractères.
# Les séquences peuvent s'avérer utiles lors de la création de réseaux d'éléments et d'itérations, mais aussi pour préparer diverses fonctions et équations.

# group: Utiliser Code Block
# note: start..end..step
# De 0 à 10 avec un intervalle de 2
# Cette méthode équivaut à utiliser le noeud Range
code_block = CodeBlock { 0..10..2; }
watch = Watch(code_block)
# note: start..end
# Lorsque la valeur d'intervalle n'est pas spécifiée, la valeur utilisée est 1.
# Cette méthode équivaut à utiliser le noeud Range
# note: Utilisez la syntaxe d'intervalle dans un Code Block. Il existe plusieurs méthodes permettant de générer une série de nombres (ou de caractères) :
#         start..end..step
#         start..end..#amount
#         start..#amount..interval
# start = nombre/caractère de début de la série
# end = nombre/caractère de fin de la série
# step = différence entre deux nombres/caractères consécutifs
# amount = quantité de nombres/caractères dans la série
code_block_2 = CodeBlock { 0..10; }
watch_2 = Watch(code_block_2)
# note: start..end..#amount
# De 0 à 10 avec incréments de 3
code_block_3 = CodeBlock { 0..10..#3; }
watch_3 = Watch(code_block_3)
# note: start..#amount..interval
# 10 incréments à partir de 0, chaque incrément est égal à 3
# Cette méthode équivaut à utiliser le noeud Sequence
code_block_4 = CodeBlock { 0..#10..3; }
watch_4 = Watch(code_block_4)

# group: Utiliser Code Block avec entrée dynamique
integer_slider = IntegerSlider(7, range=0..10 step 1)
# note: Substituez une valeur par une variable et utilisez un curseur pour contrôler la longueur de la liste de manière dynamique.
code_block_5 = CodeBlock(howMany=integer_slider) { 0..#howMany..3; }
watch_5 = Watch(code_block_5)

# group: Utiliser Sequence
number = DoubleInput(0)
number_slider = DoubleSlider(8, range=0..10 step 0.1)
number_2 = DoubleInput(2)
# note: Utilisez un noeud Sequence si le nombre d'éléments de la liste et la longueur de chaque incrément sont connus. Le dernier résultat de la liste n'est pas prédéfini, mais calculé en fonction d'autres entrées.
# Exemple : conception d'un parking avec des places de stationnement pour 8 voitures et une largeur connue pour chacune. La largeur globale de toutes les places de stationnement dépend des largeurs individuelles et du nombre d'espaces.
sequence = Sequence(start=number, amount=number_slider, step=number_2, lacing=Longest)
watch_6 = Watch(sequence)

# group: Utiliser Range
number_3 = DoubleInput(0)
number_4 = DoubleInput(10)
number_slider_2 = DoubleSlider(1.75, range=0..10 step 0.1)
# note: Utilisez un noeud Range si le début et la fin de la séquence sont connus. Le nombre d'éléments dans la liste résultante n'est pas prédéfini, mais calculé, en fonction d'autres entrées.
# Il est important de noter que le dernier élément de la liste peut ne pas correspondre à l'entrée "end" si la valeur step dépasse la valeur "end" lorsqu'elle est dépassée par un incrément supplémentaire.
# L'augmentation de la valeur step définie entre les valeurs "start" et "end" peut entraîner un nombre d'éléments inférieur et vice-versa, la baisse de valeur step rallonge la liste.
range = Range(start=number_3, end=number_4, step=number_slider_2, lacing=Longest)
watch_7 = Watch(range)

# group: Utiliser Range - avec chaînes
string = StringInput("A")
string_2 = StringInput("P")
code_block_6 = CodeBlock { 1; }
# note: Le noeud Range peut également être utilisé pour générer des séquences de caractères.
range_2 = Range(start=string, end=string_2, step=code_block_6, lacing=Longest)
watch_8 = Watch(range_2)

# group: Utiliser Sequence - avec chaînes
string_3 = StringInput("A")
code_block_7 = CodeBlock { 20; }
# note: Utiliser un noeud Sequence pour générer une série de lettres dans l'ordre alphabétique
sequence_2 = Sequence(start=string_3, amount=code_block_7)
watch_9 = Watch(sequence_2)

# note: Utiliser la séquence de valeurs pour créer une série de points
byCoordinates = Point.ByCoordinates(x=code_block_5)
