# Dynamo graph Core_Strings.dyn (Dynamo 3.4.1.7055)
# author: Dynamo Team
# Ce graphique présente les actions qui peuvent être effectuées sur les chaînes.

# group: Informations
# note: CHAINES
# Cet ensemble d'exemples présente certaines actions qui peuvent être effectuées avec des chaînes (Strings). D'autres noeuds conçus pour les opérations de chaîne sont disponibles dans la bibliothèque de noeuds sous la catégorie "String"

byCoordinates = Point.ByCoordinates()
code_block = CodeBlock { 5; }
# note: Créer un objet : cercle
byCenterPointRadius = Circle.ByCenterPointRadius(centerPoint=byCoordinates, radius=code_block)

# group: Convertir un objet en chaîne
# note: Convertissez un objet en description de lui-même sous forme de chaîne.
string_from_object = FromObject(obj=byCenterPointRadius)

watch = Watch(string_from_object)

# group: Scinder une chaîne à l'aide de séparateurs
code_block_2 = CodeBlock { "("; ")"; " "; "="; ","; }
# note: Divisez une chaîne en plusieurs parties en spécifiant un ou plusieurs caractères de séparation. Chaque séparateur peut être un ou plusieurs caractères.
split = String.Split(string=watch, separator0=code_block_2.out0, separator1=code_block_2.out1, separator2=code_block_2.out2, separator3=code_block_2.out3, separator4=code_block_2.out4)

watch_2 = Watch(split)

# group: Vérifier si la chaîne contient une sous-chaîne
code_block_3 = CodeBlock { "."; }
# note: Déterminez si une chaîne contient une autre chaîne.
contains = String.Contains(string=watch_2, searchFor=code_block_3)

watch_3 = Watch(contains)

# group: Créer une chaîne
# note: Utiliser un Code Block pour créer une chaîne : les marques "" délimitent la valeur de chaîne.
code_block_4 = CodeBlock { "Few things are harder to put up with than a good example."; }

# group: Passer en MAJUSCULES
string = StringInput(" - Mark Twain")
# note: Modifier la casse d'une chaîne
toUpper = String.ToUpper(string=string)
watch_4 = Watch(toUpper)

# group: Concaténer
# note: Le fait d'attacher deux chaînes pour en former une s'appelle "concaténation".
concat = String.Concat(string0=code_block_4, string1=watch_4)

watch_5 = Watch(concat)

# group: Remplacer des caractères dans une chaîne
code_block_5 = CodeBlock { "put"; }
code_block_6 = CodeBlock { "come"; }
# note: Remplacer toutes les occurrences d'une sous-chaîne par une chaîne de remplacement.
replace = String.Replace(string=watch_5, searchFor=code_block_5, replaceWith=code_block_6)

watch_6 = Watch(replace)

# group: Localiser une sous-chaîne dans une chaîne
code_block_7 = CodeBlock { " to"; }
# note: Rechercher l'emplacement d'une sous-chaîne spécifique dans une chaîne. Le résultat obtenu correspond à l'index où commence la sous-chaîne.
indexOf = String.IndexOf(string=watch_6, searchFor=code_block_7)
watch_7 = Watch(indexOf)

# group: Longeur de chaîne
# note: Recherchez le nombre total de caractères dans une chaîne.
length = String.Length(string=watch_6)
watch_8 = Watch(length)

# note: Soustraire la première partie de la chaîne de la longueur totale de la chaîne
sub = watch_8 - watch_7

# group: Supprimer des caractères
# note: Supprimez un certain nombre de caractères dans une chaîne.
remove = String.Remove(string=watch_6, startIndex=watch_7, count=sub)

# group: Comptabiliser les occurences
watch_9 = Watch(remove)
code_block_8 = CodeBlock { "ar"; }
# note: Comptabiliser les occurrences d'une sous-chaîne dans une chaîne.
countOccurrences = String.CountOccurrences(string=watch_9, searchFor=code_block_8)
watch_10 = Watch(countOccurrences)

# group: Créer une chaîne
# note: Si la chaîne contient un caractère ", utilisez un caractère d'échappement \ avant le caractère " pour le traiter comme faisant partie de la chaîne et non comme la fin de la chaîne.
code_block_9 = CodeBlock { "There is no \"I\" in Team"; }
watch_11 = Watch(code_block_9)

intervalle_de_nombres = CodeBlock { 2..101; }

# group: Concaténer des chaînes à l'aide du noeud 'Add'
code_block_10 = CodeBlock { " Dalmatians"; }
# note: L'opération 'Add' convertit automatiquement les nombres en chaînes et effectue une concaténation
add = intervalle_de_nombres + code_block_10
watch_12 = Watch(add)

# group: Convertir un objet en chaîne
# note: Dans certains cas, il est nécessaire de convertir un objet en chaîne en premier
string_from_object_2 = FromObject(object=intervalle_de_nombres)
watch_13 = Watch(string_from_object_2)
type = Object.Type(object=string_from_object_2)
watch_14 = Watch(type)

# group: Convertir une chaîne en nombre
code_block_11 = CodeBlock { "101 Dalmatians"; }
code_block_12 = CodeBlock { " "; }
# note: Scinder la chaîne en mots en utilisant un espace comme séparateur
split_2 = String.Split(string=code_block_11, separator0=code_block_12)
# note: Obtenir le premier élément d'une liste
firstItem = List.FirstItem(list=split_2)
# note: Convertir la chaîne en nombre
toNumber = String.ToNumber(string=firstItem)
watch_15 = Watch(toNumber)
type_2 = Object.Type(object=toNumber)
watch_16 = Watch(type_2)

# group: Convertir les chaînes en nombres
# note: Utiliser la liste booléenne comme masque pour un filtre afin d'obtenir tous les nombres dans une liste
filterByBoolMask = List.FilterByBoolMask(list=watch_2, mask=contains)
# note: Convertir les chaînes en nombres
toNumber_2 = String.ToNumber(string=filterByBoolMask.in)

watch_17 = Watch(filterByBoolMask.in)
