# Dynamo graph Geometry_Curves.dyn (Dynamo 3.1.0.3411)
# author: Dynamo Team
# Graphique d'exemple présentant la création des courbes primitives de base : ligne, PolyCurve et courbe Nurbs ouverte/fermée

# group: Informations
# note: Ce graphique présente la création des courbes primitives de base : ligne, PolyCurve et courbe Nurbs ouverte/fermée

# group: Entrées initiales
number = DoubleInput(5)
number_2 = DoubleInput(10)
number_3 = DoubleInput(15)

# group: 4 points initiaux
byCoordinates = Point.ByCoordinates()
byCoordinates_2 = Point.ByCoordinates(y=number)
byCoordinates_3 = Point.ByCoordinates(x=number_2, y=number_2)
byCoordinates_4 = Point.ByCoordinates(x=number_3)

# group: Liste de 4 points
create = List.Create(item0=byCoordinates, item1=byCoordinates_2, item2=byCoordinates_3, item3=byCoordinates_4)

# group: Courbe Nurbs
# note: Crée une courbe Nurbs passant par 4 points
byPoints = NurbsCurve.ByPoints(points=create)

# group: Ligne
# note: Ligne droite simple passant par 2 points
byStartPointEndPoint = Line.ByStartPointEndPoint(startPoint=byCoordinates, endPoint=byCoordinates_2)

length = Curve.Length(curve=byStartPointEndPoint)

# group: Courbe Nurbs - fermée
boolean = BoolSelector(true)
# note: Créer une courbe Nurbs fermée à l'intérieur des points de délimitation
byControlPoints = NurbsCurve.ByControlPoints(points=create, closeCurve=boolean)

# group: PolyCurve
# note: Créer une PolyCurve droite passant par un ensemble de points
# note: Nouvelle remarque
byPoints_2 = PolyCurve.ByPoints(points=create)

# group: Actions et requêtes
code_block = CodeBlock { 0..1..#20; }
# note: Les courbes, polycourbes (ensembles de courbes), NURBS et lignes sont toutes issues de "Courbes". Ainsi, toutes les "Actions" et "Requêtes" relatives aux courbes peuvent leur être appliquées
pointAtParameter = Curve.PointAtParameter(curve=byPoints_2, param=code_block)
