# Dynamo graph Geometry_Points.dyn (Dynamo 3.1.0.3411)
# author: Dynamo Team
# Créer un réseau de points

# group: Entrées initiales
number_slider = DoubleSlider(6.4, range=0..10 step 0.1)

# group: Point unique
# note: Les éléments géométriques de base disposent de valeurs par défaut pour les entrées numériques. Vérifiez les valeurs par défaut en faisant passer le curseur de la souris sur le port d'entrée du noeud
byCoordinates = Point.ByCoordinates(z=number_slider)

# group: Aperçu des résultats
# note: Après avoir cliqué sur "Run" ou activé l'exécution automatique, visualisez l'entité géométrique dans Aperçu en arrière-plan, dans la noeud Watch 3D ou sous forme de données dans un noeud Watch. Les éléments sont mis en surbrillance en arrière-plan lorsque le noeud est sélectionné
watch_3d = Watch3D(byCoordinates)

# group: Entrées initiales
number = DoubleInput(0)
number_2 = DoubleInput(10)
number_3 = DoubleInput(1)

# group: Intervalle de nombres
# note: Les réseaux de Geometry peuvent être créés à l'aide de séquences, d'intervalles et de listes
range = Range(start=number, end=number_2, step=number_3, lacing=Longest)

# group: Matrice de points
# note: Créez des réseaux en 1, 2 et 3 dimensions en passant des noeuds Range dans les ports x, y et z des points, puis en modifiant les propriétés de combinaison dans le menu contextuel du noeud. Observez le résultat lorsque vous choisissez l'option Combinaison de produits cartésiens
byCoordinates_2 = Point.ByCoordinates(x=range, y=range, lacing=CrossProduct)

watch = Watch(byCoordinates)

# group: Transformer le point en vecteur
# note: Certains éléments peuvent être facilement convertis en d'autres éléments
asVector = Point.AsVector(point=watch)

# group: Déplacer la matrice selon le point en tant que vecteur
# note: Les éléments dérivés peuvent être créés en utilisant des outils dans la sous-catégorie Actions de l'entité
add = Point.Add(point=byCoordinates_2, vectorToAdd=asVector)

# group: Aperçu de coordonnée Z du point
# note: Les informations peuvent être extraites de la géométrie à l'aide des noeuds de la sous-catégorie Query de chaque groupe de noeuds (à côté du symbole de point d'interrogation)
Z = Point.Z(point=byCoordinates)
