# Dynamo graph Geometry_Solids.dyn (Dynamo 3.1.0.3411)
# author: Dynamo Team
# Graphique d'exemple Dynamo présentant la création de solide à l'aide du lissage et de la manipulation de solide (addition et soustraction)

# group: Points initiaux pour le premier groupe de courbes
byCoordinates = Point.ByCoordinates()
number = DoubleInput(10)
byCoordinates_2 = Point.ByCoordinates(x=number)
byCoordinates_3 = Point.ByCoordinates(y=number)

# group: Point supplémentaire pour le deuxième groupe de courbes
number_2 = DoubleInput(5)
byCoordinates_4 = Point.ByCoordinates(z=number_2)

# group: Créer les courbes initiales pour la base inférieure
byStartPointEndPoint = Line.ByStartPointEndPoint(startPoint=byCoordinates, endPoint=byCoordinates_2)
byThreePoints = Arc.ByThreePoints(firstPoint=byCoordinates, secondPoint=byCoordinates_4, thirdPoint=byCoordinates_2)

# group: Créer la base inférieure
create = List.Create(item0=byStartPointEndPoint, item1=byThreePoints)
byJoinedCurves = PolyCurve.ByJoinedCurves(curves=create)

# group: Point supplémentaire pour le troisième groupe de courbes
number_3 = DoubleInput(15)
byCoordinates_5 = Point.ByCoordinates(x=number_3, y=number_3)

# group: Point supplémentaire pour le quatrième groupe de courbes
number_4 = DoubleInput(5)
number_5 = DoubleInput(10)
byCoordinates_6 = Point.ByCoordinates(x=number_4, y=number_5, z=number_5)

# group: Créer les courbes initiales pour la base supérieure
byStartPointEndPoint_2 = Line.ByStartPointEndPoint(startPoint=byCoordinates_3, endPoint=byCoordinates_5)
byThreePoints_2 = Arc.ByThreePoints(firstPoint=byCoordinates_3, secondPoint=byCoordinates_6, thirdPoint=byCoordinates_5)

# group: Créer la base supérieure
create_2 = List.Create(item0=byStartPointEndPoint_2, item1=byThreePoints_2)
byJoinedCurves_2 = PolyCurve.ByJoinedCurves(curves=create_2)

# group: Combiner des courbes de base dans une liste
create_3 = List.Create(item0=byJoinedCurves, item1=byJoinedCurves_2)

# group: Lissage
# note: Plusieurs méthodes de création sont disponibles pour la plupart des solides. Ces exemples présentent des profils fermés utilisés comme base, mais les polysurfaces peuvent être cousues, de nombreuses primitives sont disponibles (Surfaces, Cuboid, Cone, etc.)
byLoft = Solid.ByLoft(crossSections=create_3)

# group: Volume
# note: Vous pouvez vérifier le volume du lissage en démontrant qu'il s'agit d'une géométrie de solide fermée
volume = Solid.Volume(solid=byLoft)

# group: Point supplémentaire pour la géométrie de lissage supplémentaire
number_6 = DoubleInput(-2)
number_7 = DoubleInput(5)
byCoordinates_7 = Point.ByCoordinates(x=number_6, y=number_7)

# group: Combiner des points dans une liste
create_4 = List.Create(item0=byCoordinates, item1=byCoordinates_7, item2=byCoordinates_3)

# group: Créer une courbe de base supplémentaire
# note: Cette fois, créez une courbe Nurbs à partir du groupe de points
byPoints = NurbsCurve.ByPoints(points=create_4)

# group: Lissage +
# note: Conseil: désactiver l'"aperçu" dans le menu contextuel du noeud pour exclure des éléments de l'affichage
byLoft_2 = Solid.ByLoft(crossSections=create_3, guideCurves=byPoints)

# group: Géométrie +
code_block = CodeBlock { Vector.ByCoordinates(-20,0,0); }
# note: Déplacer la géométrie pour visualiser le résultat
translate = Geometry.Translate(geometry=byLoft_2, direction=code_block)

# group: Préparer les "ingrédients" pour l'ajustement de la géométrie de solide
# note: Epaisseur
code_block_2 = CodeBlock { 0; }
# note: Conseil: désactiver l'"aperçu" dans le menu contextuel du noeud pour exclure des éléments de l'affichage
thinShell = Solid.ThinShell(solid=byLoft, internalFaceThickness=code_block_2)
code_block_3 = CodeBlock { Vector.ByCoordinates(20,0,0); }
# note: Déplacer la géométrie de 20 unités dans la direction X
translate_2 = Geometry.Translate(geometry=thinShell, direction=code_block_3)
code_block_4 = CodeBlock { Point.ByCoordinates(0,0,5); }
ZAxis = Vector.ZAxis()
# note: Créer un plan passant par le solide de coupe
byOriginNormal = Plane.ByOriginNormal(origin=code_block_4, normal=ZAxis)
# note: Ce point détermine quelle partie du solide doit être ajustée
code_block_5 = CodeBlock { Point.ByCoordinates(10,10,10); }

# group: Lissage -
# note: Les opérations booléennes géométriques (intersection, différence, union, etc.) sont disponibles dans la catégorie Geometry.
trim = Geometry.Trim(geometry=translate_2, other=byOriginNormal, pick=code_block_5)
