# Dynamo graph Geometry_Surfaces.dyn (Dynamo 3.1.0.3411)
# Graphique Dynamo présentant les principales manières de créer des surfaces : extrusion, lissage et balayage.

# group: Informations
# note: Graphique Dynamo présentant les principales méthodes de création de surfaces : extrusion, lissage et balayage

# group: Entrée
number = DoubleInput(10)
number_2 = DoubleInput(-10)
byCoordinates = Point.ByCoordinates(x=number, y=number_2)
byCoordinates_2 = Point.ByCoordinates(y=number_2)

# group: Ligne
byStartPointEndPoint = Line.ByStartPointEndPoint(startPoint=byCoordinates, endPoint=byCoordinates_2)

# group: Entrée
byCoordinates_3 = Point.ByCoordinates()

# group: Entrée
number_3 = DoubleInput(5)
byCoordinates_4 = Point.ByCoordinates(z=number_3)

# group: Entrée
number_4 = DoubleInput(10)
byCoordinates_5 = Point.ByCoordinates(x=number_4)
byCoordinates_6 = Point.ByCoordinates(y=number_4)

# group: Arc
byThreePoints = Arc.ByThreePoints(firstPoint=byCoordinates_3, secondPoint=byCoordinates_4, thirdPoint=byCoordinates_5)

# group: Lissage
create = List.Create(item0=byStartPointEndPoint, item1=byThreePoints)
# note: Il est possible de créer une géométrie de lissage entre les deux jeux de courbes
byLoft = Surface.ByLoft(crossSections=create)

# group: Evaluer la zone de lissage
area = Surface.Area(surface=byLoft)
watch = Watch(area)

# group: Entrée
number_5 = DoubleInput(5)
number_6 = DoubleInput(10)
byCoordinates_7 = Point.ByCoordinates(x=number_5, y=number_6, z=number_6)

# group: Entrée
number_7 = DoubleInput(15)
byCoordinates_8 = Point.ByCoordinates(x=number_7, y=number_7)

# group: Arc
byThreePoints_2 = Arc.ByThreePoints(firstPoint=byCoordinates_6, secondPoint=byCoordinates_7, thirdPoint=byCoordinates_8)

# group: Entrée
number_8 = DoubleInput(-5)
number_9 = DoubleInput(5)
byCoordinates_9 = Point.ByCoordinates(x=number_8, y=number_9)

# group: Arc
byThreePoints_3 = Arc.ByThreePoints(firstPoint=byCoordinates_3, secondPoint=byCoordinates_9, thirdPoint=byCoordinates_6)

# group: Balayage
# note: Plusieurs méthodes de création sont disponibles pour la plupart des surfaces. Les surfaces, les polysurfaces (ensembles de surfaces) et les surfaces NURBS peuvent être créées par points, courbes, et dérivées à partir d'autres surfaces et solides
bySweep2Rails = Surface.BySweep2Rails(path=byThreePoints_2, guideRail=byThreePoints, profile=byThreePoints_3)

# group: Combinaison du lissage et du balayage
create_2 = List.Create(item0=byLoft, item1=bySweep2Rails)
# note: Les surfaces jointes sous forme de polysurfaces peuvent être évaluées en tant qu'entité unique
byJoinedSurfaces = PolySurface.ByJoinedSurfaces(surfaces=create_2)

# group: Evaluer la zone combinée de lissage et de balayage
area_2 = Surface.Area(surface=byJoinedSurfaces)
watch_2 = Watch(area_2)

# group: Evaluer la zone de balayage
area_3 = Surface.Area(surface=bySweep2Rails)
watch_3 = Watch(area_3)

# group: Extraire et utiliser des points à partir de la surface
code_block = CodeBlock { 0..1..0.1; }
# note: Les arêtes, les points et les autres fonctionnalités peuvent être dérivés des surfaces à l'aide des "actions" adaptées à ces géométries
pointAtParameter = Surface.PointAtParameter(surface=bySweep2Rails, u=code_block, v=code_block, lacing=CrossProduct)
# note: Créez une surface Nurbs à partir des paramètres (points) extraits.
# Masquez les autres géométries pour observer le résultat de celle ci-dessous.
byControlPoints = NurbsSurface.ByControlPoints(controlVertices=pointAtParameter)
watch_3d = Watch3D(byControlPoints)

# group: Extrusion
code_block_2 = CodeBlock { 10; }
# note: Extrusion de base à partir de la courbe fournie
extrude = Curve.Extrude(curve=byThreePoints_2, distance=code_block_2)
