# Dynamo graph ImportExport_CSV to Stuff.dyn "ImportExport_CSV vers des objets" (Dynamo 3.1.0.3411)
# author: Dynamo Team
# Créer une géométrie basée sur les données CSV analysées

# group: Entrée initiale helix.csv
# note: Parcourir un fichier CSV contenant des nombres
# dans l'espace des coordonnées X, Y et Z
file_path = Filename("..\..\Data\helix.csv")

# group: Lire le fichier
fromPath = FileObject(path=file_path)  # "File.FromPath"
readText = FileSystem.ReadText(file=fromPath)

# group: Analyser les données CSV
string = StringInput("\n")
# note: Scinder la chaîne sur
# un retour chariot<enter>
split = String.Split(string=readText, separator0=string)
string_2 = StringInput(",")
# note: Scinder la chaîne sur une virgule
split_2 = String.Split(string=split, separator0=string_2)
# note: Les fichiers CSV fournissent des chaînes, non des nombres
toNumber = String.ToNumber(string=split_2)
# note: Grouper les composants X, Y et Z
transpose = List.Transpose(lists=toNumber)

# group: Créer la géométrie de spirale en fonction des points récupérés dans le fichier CSV
# note: Coordonnée X
firstItem = List.FirstItem(list=transpose)
code_block = CodeBlock { 1; }
# note: Coordonnée Y
getItemAtIndex = List.GetItemAtIndex(list=transpose, index=code_block)
# note: Coordonnée Z
lastItem = List.LastItem(list=transpose)
byCoordinates = Point.ByCoordinates(x=firstItem, y=getItemAtIndex, z=lastItem)

# group: Extension
number_slider = DoubleSlider(2.337, range=0..20 step 0.1)
# note: Ajuster la distribution générale
# des points de coordonnées
scale = Geometry.Scale(geometry=byCoordinates, amount=number_slider, lacing=Longest)
