# Dynamo graph ImportExport_Excel to Dynamo.dyn "ImportExport_Excel vers Dynamo" (Dynamo 3.1.0.3411)
# author: Dynamo Team
# Graphique d'exemple expliquant comment importer des données Excel dans Dynamo.

# group: Entrées initiales
# note: Accéder au chemin d'accès au fichier Excel .xlsx à partir duquel charger les données.
file_path = Filename("..\..\Data\helix.xlsx")
# note: Obtenir le fichier à partir du chemin d'accès au fichier.
fromPath = FileObject(path=file_path)  # "File.FromPath"
# note: Nom de la feuille de travail Excel contenant les données à importer.
string = StringInput("helix")

# group: Importer des données Excel
# note: Ce noeud peut lire les données provenant d'une feuille de travail Excel. Il lit toutes les colonnes et lignes, dont les données obtenues sont intégrées dans un réseau de type double [][] (matrice).
importExcel = Data.ImportExcel(file=fromPath, sheetName=string)

# group: Transposer
# note: Inverser (transposer) la liste (matrice). Les colonnes deviennent des lignes et les lignes deviennent des colonnes.
transpose = List.Transpose(lists=importExcel)

# group: Extraire les coordonnées des points
number = DoubleInput(0)
# note: Coordonnée X
getItemAtIndex = List.GetItemAtIndex(list=transpose, index=number)
number_2 = DoubleInput(1)
# note: Coordonnée Y
getItemAtIndex_2 = List.GetItemAtIndex(list=transpose, index=number_2)
number_3 = DoubleInput(2)
# note: Coordonnée Z
getItemAtIndex_3 = List.GetItemAtIndex(list=transpose, index=number_3)

# group: Créer l'hélice en fonction des données extraites d'Excel
byCoordinates = Point.ByCoordinates(x=getItemAtIndex, y=getItemAtIndex_2, z=getItemAtIndex_3, lacing=Longest)
