# Dynamo graph OpenXMLExport_Data To Excel.dyn "OpenXMLExport_Data vers Excel" (Dynamo 3.0.3.7594)
# author: Dynamo Team
# Graphique d'exemple Dynamo expliquant comment exporter des données vers Excel.

# group: Entrées initiales
# note: Détermine le nombre de points. Considérez cette valeur comme la "hauteur" de l'hélice.
number_slider = DoubleSlider(1.7, range=0..5 step 0.1)

# group: Créer l'hélice
# note: Créer une série de nombres qui commence par 0. L'incrément est 10. Le nombre de points est multiplié par 360, donc si l'entrée 'numCircles' est 1, nous obtenons 37 nombres (0 à 360) et une révolution complète de l'hélice.
code_block = CodeBlock(numCircles=number_slider) { 0..(360*numCircles)..10; }
# note: fonction cosinus
cos = Math.Cos(angle=code_block, lacing=Longest)
# note: fonction sinus
sin = Math.Sin(angle=code_block, lacing=Longest)
# note: diviser par 100
code_block_2 = CodeBlock(x=code_block) { x/100; }
# note: Créer une liste de points, le composant X est le cosinus, le composant Y est le sinus et le composant Z correspond à la valeur initiale divisée par 100.
byCoordinates = Point.ByCoordinates(x=cos, y=sin, z=code_block_2, lacing=Longest)
# note: Créer une structure de liste à partir de la liste de points : nous obtenons une liste contenant 3 listes ([][] - réseau de type double), chacune contenant les coordonnées de points X, Y et Z, respectivement.
code_block_3 = CodeBlock(pt=byCoordinates) { [pt.X,pt.Y,pt.Z]; }

# group: Créer les entrées pour l'exportation
# 1. Chemin d'accès au fichier csv.
# 2. Nom de la feuille de travail.
# 3. Liste de points transposée.
# 4. Index de départ de ligne et de colonne dans Excel.
# note: Chemin d'accès au fichier xlsx.
file_path = Filename("..\..\Data\icosohedron_points.xlsx")
# note: Nom de la feuille de travail dans Excel.
string = StringInput("helix")
# note: Inverser la matrice (transposer la liste). Les colonnes deviennent des lignes et les lignes deviennent des colonnes.
transpose = List.Transpose(lists=code_block_3)
# note: Numéro de colonne/ligne du début d'enregistrement des données dans Excel
number = DoubleInput(0)

# group: Exporter les données vers un fichier Excel
# note: Exporte des données vers Excel
openXMLExportExcel = Data.OpenXMLExportExcel(filePath=file_path, sheetName=string, data=transpose, startRow=number, startColumn=number)
