# Dynamo graph OpenXMLImport_Data From Excel.dyn "OpenXMLImport_Data depuis Excel" (Dynamo 3.1.0.3411)
# author: Dynamo Team
# Graphique d'exemple d'importation de données à partir d'un fichier Excel.

# group: Entrées initiales
# 1. Chemin d'accès au fichier Excel.
# 2. Nom de la feuille de travail
file_path = Filename("..\..\Data\helix.xlsx")
string = StringInput("helix")

# group: Extrait des données à partir d'Excel
# note: Lire les données à partir d'Excel
openXMLImportExcel = Data.OpenXMLImportExcel(filePath=file_path, sheetName=string)

# group: Analyser les données à partir d'Excel
# L'analyse des données est le processus de manipulation d'une source de données de manière à ce qu'elle devienne native à l'environnement avant de pouvoir l'utiliser.
# note: Transposer la liste (inverser la matrice). Les colonnes deviennent des lignes et les lignes deviennent des colonnes.
transpose = List.Transpose(lists=openXMLImportExcel)
# note: première liste
number = DoubleInput(0)
# note: deuxième liste
number_2 = DoubleInput(1)
# note: troisième liste
number_3 = DoubleInput(2)

# group: Créer l'hélice
# note: Coordonnée X
getItemAtIndex = List.GetItemAtIndex(list=transpose, index=number)
# note: Coordonnée Y
getItemAtIndex_2 = List.GetItemAtIndex(list=transpose, index=number_2)
# note: Coordonnée Z
getItemAtIndex_3 = List.GetItemAtIndex(list=transpose, index=number_3)
byCoordinates = Point.ByCoordinates(x=getItemAtIndex, y=getItemAtIndex_2, z=getItemAtIndex_3, lacing=Longest)
