# Dynamo graph Basics_Basic01.dyn (Dynamo 2.19.3.6543)
# author: Dynamo Team
# Collega i nodi per aggiungere due numeri.

# note: Gli input funzionali di base, ad esempio i numeri e le stringhe, possono essere selezionati esplorando o cercando nella libreria a sinistra dell'area di disegno.
# Nella libreria sono inoltre disponibili le operazioni da eseguire sui dati, ad esempio le trasformazioni geometriche o matematiche
# note: Dynamo è un linguaggio di programmazione visiva. Analogamente ad altri linguaggi, funziona collegando elementi semplici per formare concetti più complessi
# note: Togliere un connettore dalla porta ">" sul nodo Number e collegarlo alla porta "y" del nodo +, quindi fare clic sul pulsante Esegui nell'angolo inferiore sinistro dell'applicazione.
number = DoubleInput(2)  # graph input
add = number + _  # unwired: y
# note: I dati possono essere visualizzati facendo clic sul pulsante Esegui nell'angolo inferiore destro dell'applicazione. Se si attiva la modalità di esecuzione Automatico, l'applicazione verrà costantemente aggiornata.
# È possibile visualizzare i dati utilizzando un nodo Watch o facendo clic sul quadratino disponibile all'estremità inferiore della maggior parte dei nodi.
watch = Watch(add)
# note: Altri file di esempio sono disponibili nel menu ?. In alternativa, chiudere il file facendo clic sulla X nella scheda per tornare alla pagina iniziale
number_2 = DoubleInput(6)  # graph input
