# Dynamo graph Basics_Basic02.dyn (Dynamo 2.19.3.6543)
# author: Dynamo Team
# Crea una linea collegando due punti.

# note: Manipola la posizione del punto nell'ambiente di Dynamo: selezionare il nodo Point.ByCoordinates e passare ad Anteprima Sfondo per trascinare il punto lungo i suoi tre assi.
byCoordinates = Point.ByCoordinates()
# note: I dati geometrici possono essere visualizzati come informazioni di testo o in uno spazio 3D
watch = Watch(byCoordinates)
number = DoubleInput(2)  # graph input
# note: Utilizzare i nodi Number Slider o Integer Slider per immettere dinamicamente un valore compreso in un intervallo specificato. Fare clic sulla freccia dell'elenco a discesa blu per aprire le impostazioni dell'intervallo numerico.
number_slider = DoubleSlider(4.43, range=0..10 step 0.1)  # graph input
# note: È possibile passare dalla navigazione nell'anteprima sfondo 3D alla navigazione nella vista grafico tramite i pulsanti nell'angolo superiore destro della schermata (tasti di scelta rapida CTRL + B). È anche possibile attivare e disattivare Anteprima sfondo nel menu Visualizza per Dynamo e Revit.
byCoordinates_2 = Point.ByCoordinates(x=number, z=number_slider)
byStartPointEndPoint = Line.ByStartPointEndPoint(startPoint=byCoordinates_2, endPoint=byCoordinates)
# note: Utilizzare il nodo Watch 3D per visualizzare l'elemento 3D in modo isolato.
watch_3d = Watch3D(byStartPointEndPoint)
