# Dynamo graph Basics_Basic03.dyn (Dynamo 2.19.3.6543)
# author: Dynamo Team
# Crea un elenco semplice.

# group: Input
# note: Gli elenchi di dati possono essere generati con sequenze e intervalli. Questi elenchi possono essere riorganizzati con molti altri nodi per scopi specifici.
number = DoubleInput(0)  # graph input
number_2 = DoubleInput(9)  # graph input
number_3 = DoubleInput(1)  # graph input

# note: Creare una sequenza di numeri, partendo da Start fino a End, con un determinato Step.
range = Range(start=number, end=number_2, step=number_3, lacing=Longest)
watch = Watch(range)
number_4 = DoubleInput(3)  # graph input
# note: Taglia l'elenco in lunghezze di 3.
chop = List.Chop(list=range, lengths=number_4)
# note: Visualizza l'anteprima del risultato e osserva la struttura dell'elenco con l'aiuto di un nodo Watch.
watch_2 = Watch(chop)
# note: Ottiene l'ultima voce in un elenco.
lastItem = List.LastItem(list=range)
watch_3 = Watch(lastItem)
