# Dynamo graph Core_AttractorPoint.dyn (Dynamo 3.0.0.6964)
# author: Dynamo Team
# Questo grafico crea una griglia di cilindri, le cui dimensioni sono determinate dalla posizione di un punto attrattore.

# group: Informazioni
# note: PUNTO ATTRATTORE
# Un punto attrattore è un punto (o un elemento) di riferimento che influenza le caratteristiche di altri elementi di un sistema. Un punto attrattore funziona spesso come un magnete: più l'elemento è vicino all'attrattore, più risente dell'influenza di quest'ultimo.
# In questo esempio, l'altezza e il diametro dei cilindri sono determinati dalla distanza tra ciascun cilindro e il punto attrattore che si muove attorno. I cilindri attorno al punto attrattore sono più piccoli di quelli più lontani.
# Per visualizzare questo funzionamento, spostare i due dispositivi di scorrimento numerici dell'input Attractor point.
# I punti attrattori sono un modo per introdurre un livello di reattività e di comportamento dinamico nel processo di progettazione.

# group: Dimensione griglia di punti
# note: Utilizzare un Code Block per creare una sequenza di numeri. In questo caso, viene creata una sequenza con numeri compresi da 1 a 50, con n incrementi, dove ogni incremento è 5.
intervallo_numeri = CodeBlock { 1..50..5; }

# group: Crea una griglia di punti.
# note: Griglia di punti.
# Per crearla, passare una serie di numeri in due porte, coordinate X e Y. Fare clic con il pulsante destro del mouse sul nodo e modificare Collegamento in Prodotto cartesiano.
# note: Il collegamento Prodotto cartesiano di un nodo combina ogni elemento di un elenco con ogni elemento di un altro elenco, dando luogo a una struttura di elenchi simile ad una griglia.
# Se utilizzato con gli input X e Y del nodo Point.ByCoordinates, il risultato è una griglia piatta di punti. Se viene utilizzata la terza coordinata Z, il risultato è una griglia di punti a forma di cubo.
byCoordinates = Point.ByCoordinates(x=intervallo_numeri, y=intervallo_numeri, lacing=CrossProduct)

# group: Riduci nidificazione struttura dell'elenco
# La struttura dell'elenco complessa non è necessaria per ulteriori azioni con i punti. Utilizzare Flatten per generare un solo elenco.
# note: Riduce la nidificazione dell'elenco perché la gerarchia di righe e colonne non è necessaria. Confrontare l'input di questo nodo con l'output: la struttura di N elenchi è stata modificata in un solo elenco.
flatten = List.Flatten(list=byCoordinates)

# group: Posizione punto attrattore
number_slider = DoubleSlider(24.6, range=-10..60 step 0.1)  # graph input
number_slider_2 = DoubleSlider(11.50111001, range=-10..60 step 0.1)  # graph input
# note: Punto attrattore. Per regolare la posizione del punto, spostare i dispositivi di scorrimento.
byCoordinates_2 = Point.ByCoordinates(x=number_slider, y=number_slider_2)

# group: Distanza dal punto attrattore
# note: Trova la distanza tra il punto attrattore e ogni punto base dei cilindri.
distanceTo = Geometry.DistanceTo(geometry=flatten, other=byCoordinates_2)

# group: Genera raggi e altezze
# note: Formula per far sì che l'altezza dei cilindri rifletta la posizione del punto attrattore. In questo esempio, l'altezza di ogni cilindro è pari alla metà della distanza dal punto attrattore. Provare con una formula diversa.
altezza_cilindro = CodeBlock(x=distanceTo) { x/2; }
# note: Una formula restituisce un valore da utilizzare come raggio del cilindro. Maggiore è la distanza, maggiore sarà il raggio di ogni cilindro. Provare a utilizzare una formula diversa.
raggio_cilindro = CodeBlock(x=distanceTo) { x/15; }

# group: Punti finali
# Converte il punto iniziale (originale) di ogni cilindro con una determinata altezza, definita dalla formula.
# note: Vettore per spostare il punto base (originale) verso l'alto di un valore specificato
byCoordinates_3 = Vector.ByCoordinates(z=altezza_cilindro)
# note: Aggiunge questo nuovo valore Z (altezza) ai punti della griglia originali per ottenere i punti superiori dei cilindri.
add = Point.Add(point=flatten, vectorToAdd=byCoordinates_3)

# group: Crea cilindri
# note: Utilizzare un metodo che consenta di creare un cilindro con un determinato punto iniziale e finale e un determinato raggio.
byPointsRadius = Cylinder.ByPointsRadius(startPoint=flatten, endPoint=add, radius=raggio_cilindro)
