# Dynamo graph Core_CodeBlocks.dyn (Dynamo 3.4.1.7055)
# author: Dynamo Team
# Questo grafico esplora vari usi e applicazioni di blocchi di codice.

# group: Informazioni
# note: BLOCCHI DI CODICE
# I blocchi di codice possono essere creati facendo doppio clic sull'area di disegno. Un blocco di codice si trova anche nella libreria dei nodi, nella categoria Script > Editor.
# I blocchi di codice possono contenere:
# •   Valori numerici (numeri interi e numeri in virgola mobile)
# •   Stringhe (testo)
# •   Valori booleani (vero o falso)
# •   Elenchi [0,1,2]
# •   Espressioni (a+3)
# •   Variabili
# Altri nodi possono essere trasformati in un'espressione di blocco di codice: selezionare uno o più nodi e fare clic con il pulsante destro del mouse nello spazio tra i nodi per selezionare Nodo da aggiungere al codice. Non esiste un equivalente inverso di questa azione: i blocchi di codice non possono essere trasformati automaticamente in nodi.

# group: Nodi come Code Block
# note: I blocchi di codice possono essere utilizzati per chiamare qualsiasi altro nodo della libreria. I nodi della libreria sono generalmente di tre tipi:
#     Create:	crea qualcosa
#     Action:	esegue un'azione su qualcosa
#     Query:		ottiene una proprietà di qualcosa
# 		che esiste già
# I metodi, o i nodi, di questi tre tipi sono trattati in modo diverso quando vengono richiamati all'interno di un blocco di codice.

# group: Creazione geometria
# note: Se utilizzate insieme, queste istruzioni formano un algoritmo che crea una curva elicoidale in corrispondenza di un punto base.
code_block = CodeBlock()
# ---------- code_block.designscript (16 lines) ----------
// Basic inputs
base = Point.ByCoordinates(3,3);
coils = 3;
height = 5;
rad = 0.5;

// Make a series of points
numPts = 8*coils + 1;
seq = 0..(coils*360)..#numPts;
x = rad * Math.Cos(seq);
y = rad * Math.Sin(seq);
z = 0..height..#numPts;
pts = Point.ByCoordinates(x + base.X, y + base.Y, z + base.Z);

// Pass a curve through those points
NurbsCurve.ByPoints(pts);
# ----------------------------------------
# note: L'algoritmo elicoidale viene trasformato in una funzione mediante l'assegnazione di un nome e l'indicazione degli input e dell'elemento da restituire.
code_block_2 = CodeBlock()
# ---------- code_block_2.designscript (13 lines) ----------
def MakeSpring(base,coils,height,rad)
{
// Make a series of points
numPts = 8*coils + 1;
seq = 0..(coils*360)..#numPts;
x = rad * Math.Cos(seq);
y = rad * Math.Sin(seq);
z = 0..height..#numPts;
pts = Point.ByCoordinates(x + base.X, y + base.Y, z + base.Z);

// Return the curve that passes through those points
return = NurbsCurve.ByPoints(pts);
};
# ----------------------------------------
code_block_3 = CodeBlock { 0..6..2; }
code_block_4 = CodeBlock { 10..20..2; }
# note: L'algoritmo elicoidale viene trasformato per definire una funzione con il nome arbitrario "MakeSpring". Tale funzione viene chiamata per creare diverse spirali con altezze casuali, disposte in una griglia.
# note: Crea una griglia
byCoordinates = Point.ByCoordinates(x=code_block_3, y=code_block_4, lacing=CrossProduct)
flatten = List.Flatten(list=byCoordinates)
code_block_5 = CodeBlock { 5; }
count = List.Count(list=flatten)
# note: Crea una serie di numeri casuali (scalati di 5) per l'altezza delle spirali
randomList = Math.RandomList(amount=count)
code_block_6 = CodeBlock(random=randomList) { random * 5; }
# note: Gli input per le chiamate di funzione possono essere creati mediante elenchi di elementi o voci a valore singolo. I dati possono essere passati tramite una porta o dichiarati direttamente, come nell'esempio dello "0.5" per i raggi di tutte le spirali.
code_block_7 = CodeBlock(basePoints=flatten, numCoils=code_block_5, height=code_block_6) { MakeSpring(basePoints,numCoils,height,0.5); }

# group: Funzioni
# note: Le funzioni possono essere definite direttamente in un nodo del blocco di codice da chiamare altrove nella definizione.
# La prima riga presenta la parola chiave "def", il nome della funzione e gli input tra parentesi.
# Le parentesi graffe definiscono il corpo della funzione. Ogni riga deve terminare con un punto e virgola.
# "return =" restituisce un valore.
code_block_8 = CodeBlock()
# ---------- code_block_8.designscript (11 lines) ----------
/* This is a multi-line comment,
     which continues for mulitple
     lines. */

def FunctionName(input1, input2)
{
// This is a comment
sum = input1 + input2;

return = sum;
};
# ----------------------------------------
code_block_9 = CodeBlock { 1; }
# note: I nodi del blocco di codice che definiscono una funzione non presentano porte di input o output, in quanto vengono chiamati da altri nodi del blocco di codice.
code_block_10 = CodeBlock { 2; }
# note: Chiama la funzione con un altro nodo del blocco di codice nodo nello stesso file, assegnando lo stesso nome e lo stesso numero di argomenti.
code_block_11 = CodeBlock(in1=code_block_9, in2=code_block_10) { FunctionName(in1,in2); }
watch = Watch(code_block_11)
code_block_12 = CodeBlock { "cat"; }
code_block_13 = CodeBlock { "dog"; }
# note: Il tipo di argomenti di input non è specificato nella definizione della funzione, che pertanto utilizza gli argomenti che riceve.
code_block_14 = CodeBlock(in1=code_block_12, in2=code_block_13) { FunctionName(in1,in2); }
watch_2 = Watch(code_block_14)
origin = Point.Origin()
code_block_15 = CodeBlock { 16; }
# note: Una chiamata di funzione con input non validi per la funzione restituisce un risultato null.
code_block_16 = CodeBlock(in1=origin, in2=code_block_15) { FunctionName(in1,in2); }
watch_3 = Watch(code_block_16)

# group: Valori numerici
# Confronta i nodi specifici e il blocco di codice.
# note: Specifico
number = DoubleInput(3.14)
risultato = Watch(number)
# note: Blocco di codice
code_block_17 = CodeBlock { 3.140; }
watch_4 = Watch(code_block_17)

# group: Valori stringa
# Confronta i nodi specifici e il blocco di codice.
# note: Specifico
string = StringInput("Less is more.")
risultato_2 = Watch(string)
# note: Utilizzare le virgolette "" per creare una stringa con un nodo Code Block.
code_block_18 = CodeBlock { "Less is more."; }
watch_5 = Watch(code_block_18)
# note: Utilizzare questo nodo per visualizzare il tipo di valore di output.
type = Object.Type(object=code_block_18)
watch_6 = Watch(type)

# group: Espressioni
# Esegue un'operazione di moltiplicazione utilizzando il nodo * specifico e utilizzando il blocco di codice.
number_2 = DoubleInput(3)
number_3 = DoubleInput(5)
# note: Moltiplica due numeri utilizzando il nodo *.
mul = number_2 * number_3
risultato_3 = Watch(mul)
# note: Esegue la moltiplicazione mediante un blocco di codice.
code_block_19 = CodeBlock { 3*5; }
watch_7 = Watch(code_block_19)
code_block_20 = CodeBlock { 3; }
code_block_21 = CodeBlock { 5; }
# note: Utilizzare le variabili come input per l'operazione di moltiplicazione.
code_block_22 = CodeBlock(a=code_block_20, b=code_block_21) { a*b; }
watch_8 = Watch(code_block_22)

# group: Query
# Metodi per l'esecuzione di query e la restituzione di una proprietà di un oggetto
# note: Con i blocchi di codice, l'utente dispone di una maggiore flessibilità per la specificazione degli input. Ad esempio, di seguito vengono illustrati diversi metodi per creare lo stesso punto.
code_block_23 = CodeBlock { 10; }
code_block_24 = CodeBlock { -10; }
# note: Metodo predefinito che utilizza il nodo Point.ByCoordinates
byCoordinates_2 = Point.ByCoordinates(x=code_block_23, y=code_block_24)
watch_9 = Watch(byCoordinates_2)
# note: Il blocco di codice utilizza un metodo Point.ByCoordinates con tre variabili per X, Y e Z, dove Z è definita all'interno dello stesso blocco di codice e separato da un simbolo di punto e virgola ';'.
code_block_25 = CodeBlock(x=code_block_23, y=code_block_24) { z = 0; Point.ByCoordinates(x,y,z); }
watch_10 = Watch(code_block_25.out1)
code_block_26 = CodeBlock { Point.ByCoordinates(10,0,0); }
# note: Un blocco di codice equivalente allo stesso metodo. I metodi Query non richiedono parentesi.
code_block_27 = CodeBlock(pt=code_block_26) { pt.X; }
watch_11 = Watch(code_block_27)
# note: Metodo di query predefinito che restituisce la coordinata X del punto
X = Point.X(point=code_block_26)
watch_12 = Watch(X)
# note: Una formula che utilizza un valore negativo dello stesso valore numerico qui è integrata nella notazione per le variabili di input.
code_block_28 = CodeBlock(num=code_block_23) { Point.ByCoordinates(num,-num,0); }
watch_13 = Watch(code_block_28)
# note: Il blocco di codice utilizza un metodo Point.ByCoordinates; tutte e tre le variabili vengono fornite come input.
code_block_29 = CodeBlock { Point.ByCoordinates(10,-10,0); }
watch_14 = Watch(code_block_29)

# group: Crea
# Metodi per la creazione di geometria, elenchi, elementi di Revit o altri oggetti
# note: Metodo predefinito per la creazione di un punto in corrispondenza dell'origine
origin_2 = Point.Origin()
watch_15 = Watch(origin_2)
# note: Sebbene per questo metodo non siano necessari input, sono richieste le parentesi.
code_block_30 = CodeBlock { Point.Origin(); }
watch_16 = Watch(code_block_30)
code_block_31 = CodeBlock { 0; -10; }
# note: Metodo predefinito per la creazione di un punto fornendo le coordinate X e Y
byCoordinates_3 = Point.ByCoordinates(x=code_block_31.out0, y=code_block_31.out1)
watch_17 = Watch(byCoordinates_3)
# note: Utilizzare un Code Block per replicare il funzionamento del nodo Point.ByCoordinates. Il nome del metodo verrà trovato se si posiziona il cursore del mouse sul nodo predefinito originale: il metodo viene indicato nella parte inferiore della finestra della descrizione comando.
# Gli input devono essere specificati nell'ordine rilevato nel nodo predefinito.
code_block_32 = CodeBlock { Point.ByCoordinates(0,-10); }
watch_18 = Watch(code_block_32)

# group: Azione
# Metodi per l'esecuzione di un'azione su un oggetto
origin_3 = Point.Origin()
ZAxis = Vector.ZAxis()
# note: Metodo predefinito per l'aggiunta di un vettore ad un punto
add = Point.Add(point=origin_3, vectorToAdd=ZAxis)
watch_19 = Watch(add)
origin_4 = Point.Origin()
ZAxis_2 = Vector.ZAxis()
# note: I metodi Action vengono eseguiti su un oggetto. Utilizzare la notazione punto dopo l'oggetto stesso e specificare il metodo e tutti gli input trovati sul nodo predefinito, ad eccezione del primo (poiché la prima porta di input è l'oggetto stesso, che è già presente).
code_block_33 = CodeBlock(pt=origin_4, vector=ZAxis_2) { pt.Add(vector); }
watch_20 = Watch(code_block_33)

# group: Crea elenchi
# note: Crear elenchi utilizzando le parentesi quadre per definire l'elenco e le virgole per separare i singoli elementi.
code_block_34 = CodeBlock { ["San Francisco","New York","Chicago"]; }
watch_21 = Watch(code_block_34)
# note: Ottiene voci da un elenco utilizzando la seguente notazione: list [ i ], dove i è l'indice della voce. Questo metodo è identico all'utilizzo del nodo GetItemAtIndex.
code_block_35 = CodeBlock(cities=watch_21) { cities[2]; }
watch_22 = Watch(code_block_35)
# note: In questo blocco di codice vengono definite più variabili e alla fine viene creato un elenco contenente tutte le variabili.
code_block_36 = CodeBlock()
# ---------- code_block_36.designscript (7 lines) ----------
str0 = "alpha";
str1 = "beta";
str2 = "charlie";
str3 = "delta";
str4 = "echo";
//
[str0,str1,str2,str3,str4];
# ----------------------------------------
watch_23 = Watch(code_block_36.out5)
code_block_37 = CodeBlock(phonetic=watch_23) { phonetic[2..3]; }
watch_24 = Watch(code_block_37)
code_block_38 = CodeBlock { 2; }
getItemAtIndex = List.GetItemAtIndex(list=watch_21, index=code_block_38)
watch_25 = Watch(getItemAtIndex)

# group: Combina elenchi e accedi alle voci
# Descrizione <Fare doppio clic qui per modificare la descrizione del gruppo>
# note: Crea elenchi nidificati e ottiene elementi dagli elenchi nidificati.
code_block_39 = CodeBlock()
# ---------- code_block_39.designscript (6 lines) ----------
kitchen = ["table","stove","sink","refrigerator"];
livingRoom = ["sofa","books"];
bedroom = ["bed","dirty clothes"];
bathroom = ["tooth brush"];
//
allMyStuff = [kitchen, livingRoom, bedroom, bathroom];
# ----------------------------------------
watch_26 = Watch(code_block_39.allMyStuff)
# note: Accede alla seconda voce all'interno del terzo elenco (o, in altre parole, accede alla voce con indice 1 all'interno dell'elenco con indice 2).
code_block_40 = CodeBlock(list=watch_26) { list[2][1]; }
watch_27 = Watch(code_block_40)

# group: Replica
# note: Le guide per la replica possono essere utilizzate per specificare che gli elenchi devono essere collegati come Prodotto cartesiano
code_block_41 = CodeBlock { x_vals = 0..10; y_vals = -30..-40; }
code_block_42 = CodeBlock(x_vals=code_block_41.x_vals, y_vals=code_block_41.y_vals) { Point.ByCoordinates(x_vals, y_vals); }
code_block_43 = CodeBlock { x_vals = 0..10; y_vals = -15..-25; }
code_block_44 = CodeBlock(x_vals=code_block_43.x_vals, y_vals=code_block_43.y_vals) { Point.ByCoordinates(x_vals<1>, y_vals<2>); }
byCoordinates_4 = Point.ByCoordinates(x=code_block_41.x_vals, y=code_block_41.y_vals)
byCoordinates_5 = Point.ByCoordinates(x=code_block_43.x_vals, y=code_block_43.y_vals, lacing=CrossProduct)
# note: Le guide per la replica, che utilizzano parentesi angolari, si servono di raccolte bi o tridimensionali e associano gli elementi per generare una singola raccolta uni, bi o tridimensionale.
# note: Nell'esempio sono presenti 2 valori X e 5 valori Y. Le guide per la replica possono specificare se la combinazione risultante deve essere composta da 2 elenchi di 5 punti o da 5 elenchi di 2 punti.
code_block_45 = CodeBlock()
# ---------- code_block_45.designscript (5 lines) ----------
x_vals = 0..1;
y_vals = -3..-7;
//
Point.ByCoordinates(x_vals<1>, y_vals<2>);
Point.ByCoordinates(x_vals<2>, y_vals<1>);
# ----------------------------------------
watch_28 = Watch(code_block_45.out2)
watch_29 = Watch(code_block_45.out3)

# group: Booleano
# Confronta i nodi specifici e il blocco di codice.
# note: Nodo di attivazione/disattivazione di valori booleani
boolean = BoolSelector(true)
watch_30 = Watch(boolean)
# note: Utilizzare i valori true o false in un blocco di codice per ottenere lo stesso risultato.
code_block_46 = CodeBlock { true; }
watch_31 = Watch(code_block_46)
