# Dynamo graph Core_ListAtLevel.dyn (Dynamo 3.1.0.3411)
# author: Dynamo Team
# Sono illustrati List@Level e il modo in cui può essere utilizzato per ottenere gli stessi risultati del nodo List.Map. È creata una serie di pannelli per mostrare il reale funzionamento di List@Level.

# group: Informazioni
# note: Per determinare il livello dell'elenco che si desidera utilizzare, osservare la parte inferiore del simbolo circolare di anteprima o il nodo e seguire le linee dalla notazione List@Level verso l'alto.

# group: Informazioni
# Informazioni generali per l'utilizzo di List@Level
# note: LIST@LEVEL
# List@Level sostituisce la funzionalità List.Map, consentendo di selezionare direttamente il livello dell'elenco che si desidera utilizzare.
# note: Per modificare il livello dell'elenco che si sta utilizzando, fare clic sulla freccia accanto alla porta di input dell'elenco e attivare l'opzione "Usa livelli".
# Quando si attiva List@Level per la prima volta in una porta di input, l'elenco in corrispondenza del secondo livello più interno (L2) viene selezionato per essere utilizzato.

# group: Informazioni
# Funzionamento di questo grafico
# note: Si desidera creare pannelli nella parte interna della griglia. A tale scopo, sarà necessario ottenere i punti in corrispondenza degli indici 1 e 2 di ogni elenco nel livello più interno. Questa operazione può essere eseguita facilmente utilizzando la funzionalità List@Level. Il raggruppamento degli elenchi viene mantenuto attivando l'opzione "Mantieni struttura elenco". Prima, però, occorre esaminare meglio l'elenco creato con Point.ByCoordinates per determinare il livello dell'elenco che si desidera utilizzare.

# group: Input
# Descrizione <Fare doppio clic qui per modificare la descrizione del gruppo>
code_block = CodeBlock { 0..30..#8; 12..0..#4; }
# note: In questo esempio, viene creato un elenco 3D contenente una serie di punti. Esistono 8 elenchi in corrispondenza di L3, ciascuno dei quali contiene altri 4 elenchi (L2). Ciascuno dei 4 elenchi contiene 4 punti (L1), per un totale di 128 punti.
byCoordinates = Point.ByCoordinates(x=code_block.out0, y=code_block.out1, z=code_block.out1, lacing=CrossProduct)

# group: Sostituzione di List.Map con List@Level
code_block_2 = CodeBlock { [1,2]; }
# note: Nella versione precedente di Dynamo, la funzionalità List.Map veniva utilizzata per ottenere i livelli interni degli elenchi. Anche se può essere ottenuto lo stesso risultato utilizzando List.Map, si introducono più nodi nell'area di lavoro. Qui si utilizza List@Level per ottenere i punti interni della griglia in maniera più efficiente. Verranno utilizzati questi punti per creare i pannelli.
# È stata utilizzata anche l'opzione "Mantieni struttura elenco" per mantenere i raggruppamenti dell'elenco iniziale e impedire la riduzione. Se l'opzione "Mantieni struttura elenco" è disattivata, verrà creata un'unica NurbsSurface anziché otto.
getItemAtIndex = List.GetItemAtIndex(list=byCoordinates@@L2, index=code_block_2)
code_block_3 = CodeBlock { [1,2]; }
# note: Gli elenchi sono presenti in corrispondenza di livelli differenti, con L1, che è il livello più basso. Il numero totale di elementi creati da questo nodo è 64, come mostrato in basso a destra.
getItemAtIndex_2 = List.GetItemAtIndex(index=code_block_3)  # unwired: list
# note: Di seguito è riportata la funzionalità List.Map equivalente all'applicazione di List@Level che richiede nodi aggiuntivi.
map = List.Map(f_x=getItemAtIndex_2)  # unwired: list
map_2 = List.Map(list=byCoordinates, f_x=map)

# group: Creazione della geometria
# note: Con i gruppi di punti selezionati, adesso è possibile creare pannelli.
byPoints = NurbsSurface.ByPoints(points=getItemAtIndex)
byBestFitThroughPoints = Line.ByBestFitThroughPoints(bestFitPoints=getItemAtIndex)

# group: Ispezione di un elenco con List@Level e Count
# note: Il nodo List.Count restituisce il numero di elementi presenti in ogni elenco. A seconda del livello selezionato, vengono restituiti valori differenti. Provare a modificare il valore di L3 facendo clic sulle frecce accanto ad esso.
# note: Esistono otto elenchi in corrispondenza di L3, ciascuno contenente quattro elenchi. Quindi, selezionando L3 si implementa la funzione List.Count negli otto elenchi, restituendo otto valori '4'.
count = List.Count(list=byCoordinates@L3)

# group: Uso di "Mantieni struttura elenco"
# note: Questo nodo restituisce il numero di elementi presenti in ogni elenco in L2. Per default, i risultati vengono ridotti in un elenco 1D.
count_2 = List.Count(list=byCoordinates@L2)
# note: Per mantenere la struttura nidificata degli elenchi, selezionare l'opzione "Mantieni struttura elenco". "@@" indica come mantenere la struttura elenco in DesignScript.
count_3 = List.Count(list=byCoordinates@@L2)

# group: Ispezione di un elenco con List@Level e Flatten
# note: Come esempio aggiuntivo, si può facilmente ridurre la struttura nidificata in corrispondenza dei livelli interni degli elenchi mediante l'uso della funzionalità List@Level, insieme al nodo Flatten. Provare a modificare il livello che verrà ridotto facendo clic sulle frecce accanto al selettore numerico List@Level.
# note: Selezionando L3 si convertono gli otto elenchi in corrispondenza di tale livello in una matrice 1D. Poiché ciascuno degli otto elenchi contiene quattro voci (che sono anche elenchi), in questo modo verranno ridotti tutti gli elenchi in corrispondenza di L3 e verranno creati otto elenchi di 16 punti.
flatten = List.Flatten(list=byCoordinates@L3)
