# Dynamo graph Core_ListLacing.dyn (Dynamo 3.1.0.3411)
# author: Dynamo Team
# Collegamento di elenchi: in questo grafico sono esplorate e mostrate tutte le modalità di Collegamento di elenchi.

# group: Informazioni
# note: COLLEGAMENTO DI ELENCHI
# Il collegamento viene utilizzato dai nodi di Dynamo per individuare corrispondenze tra gli elementi di elenchi diversi. Per la maggior parte dei nodi di Dynamo è possibile scegliere la modalità di combinazione degli elenchi di informazioni impostando il funzionamento del collegamento.
# Ognuno di questi esempi presenta due elenchi di punti da passare al nodo Line.ByStartPointEndPoint. Il nodo che crea la linea deve indicare quante linee disegnare e tra quali insiemi di punti disegnarle.
# Per impostare il funzionamento del collegamento, fare clic con il pulsante destro del mouse su un nodo che presenta due o più porte di input e scegliere Collegamento.

# group: Suggerimento
# note: Suggerimento: visualizzare l'indice dell'elemento come etichetta nell'anteprima sfondo per tutti i nodi che creano geometria. Fare clic con il pulsante destro del mouse e scegliere Mostra etichette

# group: Suggerimento
# note: Suggerimento: la modalità di collegamento di un nodo è indicata sul nodo da un piccolo glifo nell'angolo inferiore destro. Se non viene visualizzato alcun glifo, il nodo non può eseguire il collegamento.

# group: Input
# note: Serie più lunga (10 elementi)
code_block = CodeBlock { 0..9; }
code_block_2 = CodeBlock { 4; }
# note: Serie più corta (6 elementi)
code_block_3 = CodeBlock { 0..5; }
code_block_4 = CodeBlock { 0..9; }
code_block_5 = CodeBlock { -10; 4; }
code_block_6 = CodeBlock { 0..5; }
code_block_7 = CodeBlock { 0..9; }
code_block_8 = CodeBlock { 10; 4; }
code_block_9 = CodeBlock { 0..5; }

# group: Crea punti
# Crea due gruppi di punti per (10 x 6) da utilizzare come input per Line.ByStartPointEndPoint.
byCoordinates = Point.ByCoordinates(x=code_block, z=code_block_2)
byCoordinates_2 = Point.ByCoordinates(x=code_block_3)

# group: Il collegamento più lungo
# note: Collegamento più lungo
# Viene disegnato un numero di linee corrispondente al numero di voci contenute nell'elenco di punti di input più lungo. Quando i punti contenuti nell'elenco più breve si esauriscono, vengono eseguite copie dell'ultima voce, poiché deve corrispondere alle voci finali dell'elenco più lungo.
byStartPointEndPoint = Line.ByStartPointEndPoint(startPoint=byCoordinates, endPoint=byCoordinates_2, lacing=Longest)

# group: Crea punti
# Crea due gruppi di punti per (10 x 6) da utilizzare come input per Line.ByStartPointEndPoint.
byCoordinates_3 = Point.ByCoordinates(x=code_block_4, y=code_block_5.out0, z=code_block_5.out1)
byCoordinates_4 = Point.ByCoordinates(x=code_block_6, y=code_block_5.out0)

# group: Il collegamento più corto
# note: Collegamento più breve
# Viene disegnato un numero di linee corrispondente al numero di voci contenute nell'elenco di input più breve. I punti aggiuntivi contenuti nell'elenco più lungo vengono ignorati.
byStartPointEndPoint_2 = Line.ByStartPointEndPoint(startPoint=byCoordinates_3, endPoint=byCoordinates_4)

# group: Crea punti
# Crea due gruppi di punti per (10 x 6) da utilizzare come input per Line.ByStartPointEndPoint.
byCoordinates_5 = Point.ByCoordinates(x=code_block_7, y=code_block_8.out0, z=code_block_8.out1)
byCoordinates_6 = Point.ByCoordinates(x=code_block_9, y=code_block_8.out0)

# group: Collegamento Prodotto cartesiano
# note: Collegamento Prodotto cartesiano
# Vengono eseguite tutte le possibili combinazioni di associazioni. Per 10 punti nell'elenco più lungo e 6 punti nell'elenco più breve, verranno create 10 x 6 = 60 linee.
byStartPointEndPoint_3 = Line.ByStartPointEndPoint(startPoint=byCoordinates_5, endPoint=byCoordinates_6, lacing=CrossProduct)
# note: Le linee risultanti vengono memorizzate in un elenco nidificato (6 elenchi da 10 linee o 10 elenchi da 6 linee), a seconda dell'elenco specificato per primo.
watch = Watch(byStartPointEndPoint_3)
