# Dynamo graph Core_Math.dyn (Dynamo 3.4.1.7055)
# author: Dynamo Team
# Si tratta di un'esplorazione approfondita delle varie funzioni e capacità matematiche di Dynamo.

# group: Informazioni
# note: MATEMATICA
# È possibile eseguire la funzione matematica in Dynamo con i nodi della libreria Math e della libreria Operators o con un Code Block. Di seguito è illustrato come eseguire diverse operazioni matematiche di base con ciascuno di questi tre metodi.

# group: Operatori aritmetici di base
# note: Operatori aritmetici, ad esempio +, -, *, /, %

# group: Operatori logici di base
# note: Operatori di confronto, ad esempio
# <,>, <=,>=, !=, ==

# group: Operatori booleani
# note: Operatori booleani
# (altri operatori sono disponibili nella libreria)

# group: Arrotondamento
# note: Arrotondamento

# group: Funzioni matematiche complesse
# 4 esempi di come ottenere lo stesso risultato finale utilizzando nodi, Python, Fo
# note: Questo esempio mostra quattro diversi modi per utilizzare le funzioni matematiche. Ciascuno di questi esempi inizia con una griglia di punti, calcola le coordinate Z per i punti e quindi crea una superficie. Solo il metodo di calcolo differisce; questi metodi funzionano tutti allo stesso modo.
# 1. Nodi. I nodi Math sono nella sezione Math della Libreria, che è ulteriormente suddivisa in Functions, Logic e Operators.
# 2. Python.
# 3. Nodo Code Block. Fare doppio clic in un punto qualsiasi dell'area di disegno per creare un nodo Code Block. La sintassi di ogni funzione corrisponde al nome del nodo in Dynamo.
# ** Nota: è possibile regolare la risoluzione dell'anteprima della geometria accedendo alle impostazioni di Precisione di rendering: Dynamo -> Preferenze -> Impostazioni visive-> Precisione di rendering.
# note: Per ulteriori informazioni sull'esempio, visitare il sito
# http://dynamobim.org/math-transit/

# group: Arco
# note: Crea un arco utilizzando 2 metodi separati, una volta mediante i nodi e una volta mediante i blocchi di codice. I risultati vengono visualizzati per maggiore chiarezza.

# group: Suggerimento
# Evidenzia i nodi della geometria.
# note: Suggerimento: se si seleziona un nodo che disegna geometria, la geometria viene disegnata in ciano. Il blocco di codice disegna gli assi di un grafico, i punti lungo la curva e la curva. Selezionare il blocco di codice per visualizzare sullo sfondo la curva disegnata.

# group: Curva coseno
# note: Questo insieme di esempi mostra come eseguire il grafico di una funzione coseno utilizzando i nodi e un blocco di codice.
# Ogni esempio utilizza una serie di numeri come valori x per una serie di punti, calcola i valori y dai valori x e quindi disegna una linea a forma di curva coseno. Il blocco di codice grande alla fine di ogni grafico sposta la geometria disegnata in una parte diversa della schermata, in modo che non si sovrappongano tutti gli elementi.

# group: Suggerimento
# Precisione di rendering
# note: Suggerimento: regolare la precisione di rendering della geometria nell'anteprima di sfondo accedendo a Dynamo -> Preferenze -> Impostazioni visive -> Precisione di rendering. Un valore più elevato renderà le superfici curve più uniformi, ma richiederà una maggiore potenza di elaborazione per il disegno.

# group: Nodi > Input iniziale per l'elenco di punti
code_block = CodeBlock { -10..10..#20; }

# group: Nodi > Creazione e manipolazione dell'elenco di punti iniziali
# note: Crea una griglia di punti.
# La modalità di collegamento è
# Prodotto cartesiano.
byCoordinates = Point.ByCoordinates(x=code_block, y=code_block, lacing=CrossProduct)
flatten = List.Flatten(list=byCoordinates)
X = Point.X(point=flatten)
Y = Point.Y(point=flatten)

# group: Nodi > Ampiezza
# note: Ampiezza
number_slider = DoubleSlider(5.51, range=0..10 step 0.1)  # graph input

# group: Nodi > Quadrato
number = DoubleInput(2)  # graph input
pow = Math.Pow(number=X, power=number)

# group: Nodi > Quadrato
number_2 = DoubleInput(2)  # graph input
pow_2 = Math.Pow(number=Y, power=number_2)

# group: Nodi > Frequenza
# note: Frequenza
number_slider_2 = DoubleSlider(1.724, range=0..6 step 0.1)  # graph input

# group: Nodi > Quadrato
number_3 = DoubleInput(2)  # graph input
pow_3 = Math.Pow(number=number_slider_2, power=number_3)

# group: Nodi > La serie di manipolazioni e di calcoli matematici per creare la geometria "a onde" utilizzando i nodi
add = pow + pow_2
add_2 = add + pow_3
sqrt = Math.Sqrt(number=add_2)
# note: Gli angoli in Dynamo sono espressi in gradi
radiansToDegrees = Math.RadiansToDegrees(radians=sqrt)
sin = Math.Sin(angle=radiansToDegrees)
div = sin / sqrt
mul = number_slider * div

# group: Nodi > Raccoglie i punti risultanti e prepara il rendering finale.
byCoordinates_2 = Point.ByCoordinates(x=X, y=Y, z=mul)
# note: Conteggia il numero di gruppi di punti dalla raccolta iniziale di punti (20x20).
count = List.Count(list=byCoordinates)

# group: Nodi > La raccolta di punti
# note: Suddivide l'elenco non strutturato in una serie di elenchi per riga
chop = List.Chop(list=byCoordinates_2, lengths=count)

# group: Nodi > La rete di curve
# note: Crea curve NURBS mediante punti
byPoints = NurbsCurve.ByPoints(points=chop)

# group: Nodi > La superficie finale
# note: Crea una superficie
byLoft = Surface.ByLoft(crossSections=byPoints)

# group: Blocco di codice > Input iniziale per l'elenco di punti
code_block_2 = CodeBlock { -10..10..#20; }

# group: Blocco di codice > Creazione e manipolazione dell'elenco di punti iniziali
byCoordinates_3 = Point.ByCoordinates(x=code_block_2, y=code_block_2, lacing=CrossProduct)
flatten_2 = List.Flatten(list=byCoordinates_3)
Y_2 = Point.Y(point=flatten_2)
X_2 = Point.X(point=flatten_2)

# group: Blocco di codice > Funzione helper per spostare la geometria
# note: Sposta la geometria
code_block_3 = CodeBlock(x=Y_2) { x+60; }

# group: Blocco di codice > Frequenza
number_slider_3 = DoubleSlider(1.724, range=0..5 step 0.1)  # graph input

# group: Blocco di codice > Ampiezza
number_slider_4 = DoubleSlider(5.51, range=0..10 step 0.1)  # graph input

# group: Blocco di codice > La serie di manipolazioni e di calcoli matematici per creare la geometria "a onde" utilizzando Python
# note: I nomi dei metodi matematici corrispondono ai nomi dei nodi di Dynamo utilizzati nel primo esempio.
code_block_4 = CodeBlock(x=X_2, y=Y_2, c=number_slider_3, A=number_slider_4)
# ---------- code_block_4.designscript (6 lines) ----------
sum = Math.Pow(x,2) + Math.Pow(y,2) + Math.Pow(c,2);

num1 = Math.Sqrt(sum);
num2 = Math.Sin( Math.RadiansToDegrees(num1) );

A * num2 / num1;
# ----------------------------------------

# group: Blocco di codice > Raccoglie i punti risultanti e prepara il rendering finale.
byCoordinates_4 = Point.ByCoordinates(x=code_block_3, y=X_2, z=code_block_4.out3)
count_2 = List.Count(list=byCoordinates_3)

# group: Blocco di codice > La raccolta di punti
chop_2 = List.Chop(list=byCoordinates_4, lengths=count_2)

# group: Blocco di codice > La rete di curve
byPoints_2 = NurbsCurve.ByPoints(points=chop_2)

# group: Blocco di codice > La superficie finale
byLoft_2 = Surface.ByLoft(crossSections=byPoints_2)

# group: Python > Input iniziale per l'elenco di punti
code_block_5 = CodeBlock { -10..10..#20; }

# group: Python > Creazione e manipolazione dell'elenco di punti iniziali
byCoordinates_5 = Point.ByCoordinates(x=code_block_5, y=code_block_5, lacing=CrossProduct)
flatten_3 = List.Flatten(list=byCoordinates_5)
X_3 = Point.X(point=flatten_3)
Y_3 = Point.Y(point=flatten_3)

# group: Python > Funzione helper per spostare la geometria
# note: Sposta la geometria
code_block_6 = CodeBlock(x=X_3) { x+30; }

# group: Python > Ampiezza
number_slider_5 = DoubleSlider(5.51, range=0..10 step 0.1)  # graph input

# group: Python > Frequenza
number_slider_6 = DoubleSlider(1.724, range=0..5 step 0.1)  # graph input

# group: Python > La serie di manipolazioni e di calcoli matematici per creare la geometria "a onde" utilizzando Python
python_script = Python(Amplitude=number_slider_5, X=X_3, Y=Y_3, Frequency=number_slider_6)  # PythonNet3
# ---------- python_script.python (27 lines) ----------
import clr
clr.AddReference('ProtoGeometry')
from Autodesk.DesignScript.Geometry import *

import math

# The inputs to this node will be stored as a list in the IN variable.
amp = IN[0]   # single value
x = IN[1]     # list
y = IN[2]     # list (expect same length as x)
c = IN[3]     # single value

# Declare an empty array of z-values
z = []

# Solve the equation for each x and y value
for index in range(len(x)):
	sum = math.pow(x[index],2) + math.pow(y[index],2) + math.pow(c,2)
	num1 = math.sqrt(sum)
	num2 = math.sin(num1)
	zVal = amp * num2 / num1
	
	# Append the answer to the list of z values
	z.append(zVal)

# Assign the z-values to the OUT variable
OUT = z
# ----------------------------------------

# group: Python > Raccoglie i punti risultanti e prepara il rendering finale.
byCoordinates_6 = Point.ByCoordinates(x=code_block_6, y=Y_3, z=python_script)
count_3 = List.Count(list=byCoordinates_5)

# group: Python > La raccolta di punti
chop_3 = List.Chop(list=byCoordinates_6, lengths=count_3)

# group: Python > La rete di curve
byPoints_3 = NurbsCurve.ByPoints(points=chop_3)

# group: Python > La superficie finale
byLoft_3 = Surface.ByLoft(crossSections=byPoints_3)

# group: Curva coseno mediante blocchi di codice > Input
# note: Punto base coordinata
code_block_7 = CodeBlock { 25; 20; }
# note: Serie di valori X
code_block_8 = CodeBlock { 0..10..#20; }
# note: Ampiezza
number_slider_7 = DoubleSlider(3, range=0..10 step 0.1)  # graph input
# note: Frequenza
number_slider_8 = DoubleSlider(36, range=0..100 step 0.1)  # graph input

# group: Curva coseno mediante blocchi di codice > Funzione curva cos
# Ottiene il valore coseno per la frequenza e l'angolo specificati moltiplicandolo per l'ampiezza.
code_block_9 = CodeBlock(amplitude=number_slider_7, frequency=number_slider_8, angle=code_block_8) { amplitude * Math.Cos(frequency * angle); }

# group: Curva coseno mediante blocchi di codice > Operazioni intermedie
byCoordinates_7 = Point.ByCoordinates(x=code_block_7.out0, y=code_block_7.out1)
byCoordinates_8 = Point.ByCoordinates(x=code_block_8, y=code_block_9)

# group: Curva coseno mediante blocchi di codice > Crea e visualizza la curva coseno.
code_block_10 = CodeBlock(base=byCoordinates_7, pts=byCoordinates_8)
# ---------- code_block_10.designscript (14 lines) ----------
// Make axes from base point
dimension = 10;
top = Point.ByCoordinates(base.X, base.Y + dimension/2);
bottom = Point.ByCoordinates(base.X, base.Y - dimension/2);
right = Point.ByCoordinates(base.X + 10, base.Y);
Line.ByStartPointEndPoint(bottom, top);
Line.ByStartPointEndPoint(base, right);

// Move function results to base point
vec = base.AsVector();
newPts = pts.Add(vec);

// Draw a line through the points
NurbsCurve.ByPoints(newPts);
# ----------------------------------------

# group: Coseno curva mediante nodi > Input
# note: Coordinate x, y del punto base
code_block_11 = CodeBlock { -5; 20; }
# note: Serie di valori X
code_block_12 = CodeBlock { 0..10..#20; }
# note: Frequenza
number_slider_9 = DoubleSlider(36, range=0..100 step 0.1)  # graph input

# group: Coseno curva mediante nodi > Controlla l'ampiezza.
# note: Ampiezza
number_slider_10 = DoubleSlider(3, range=0..10 step 0.1)  # graph input

# group: Coseno curva mediante nodi
mul_2 = number_slider_9 * code_block_12

# group: Coseno curva mediante nodi > Funzione Math.Cos
# Ottiene il valore coseno per ogni numero iniziale.
cos = Math.Cos(angle=mul_2)

# group (continued): Coseno curva mediante nodi
mul_3 = number_slider_10 * cos

# group: Coseno curva mediante nodi > Operazioni intermedie
byCoordinates_9 = Point.ByCoordinates(x=code_block_11.out0, y=code_block_11.out1)
# note: Suggerimento: è possibile attivare o disattivare la funzionalità di anteprima per qualsiasi nodo che crea geometria. Fare clic con il pulsante destro del mouse e selezionare o deselezionare Anteprima
byCoordinates_10 = Point.ByCoordinates(x=code_block_12, y=mul_3)

# group: Coseno curva mediante nodi > Crea e visualizza la curva coseno.
code_block_13 = CodeBlock(base=byCoordinates_9, pts=byCoordinates_10)  # same code as code_block_10

# group: Arco mediante nodi > Input
# Crea gli input necessari:
# 1. Punto centrale
# 2. Raggio
# 3. Angolo iniziale
# 4. Angolo finale
# 5. Normale (asse Z)
code_block_14 = CodeBlock { 0; 35; }
byCoordinates_11 = Point.ByCoordinates(x=code_block_14.out0, y=code_block_14.out1)
code_block_15 = CodeBlock { 5; 0; }
# note: Spostare il dispositivo di scorrimento per modificare la lunghezza dell'arco.
number_slider_11 = DoubleSlider(247.821, range=0..360 step 0.1)  # graph input
ZAxis = Vector.ZAxis()

# group: Arco mediante nodi > Crea l'arco mediante punto centrale, raggio e angolo.
# note: Nei nodi e nei blocchi di codice gli angoli sono espressi in radianti.
byCenterPointRadiusAngle = Arc.ByCenterPointRadiusAngle(center=byCoordinates_11, radius=code_block_15.out0, startAngle=code_block_15.out1, endAngle=number_slider_11, normal=ZAxis)

# group: Arco mediante nodi > Visualizza gli output
endPoint = Curve.EndPoint(curve=byCenterPointRadiusAngle)
byStartPointEndPoint = Line.ByStartPointEndPoint(startPoint=endPoint, endPoint=byCoordinates_11)
startPoint = Curve.StartPoint(curve=byCenterPointRadiusAngle)
byStartPointEndPoint_2 = Line.ByStartPointEndPoint(startPoint=startPoint, endPoint=byCoordinates_11)

# group: Operazioni mediante nodi > -
code_block_16 = CodeBlock { 5; 2; }
sub = code_block_16.out0 - code_block_16.out1
watch = Watch(sub)

# group: Operazioni mediante blocchi di codice > -
code_block_17 = CodeBlock { 5-2; }
watch_2 = Watch(code_block_17)

# group: Operazioni mediante blocchi di codice > %
code_block_18 = CodeBlock { 5%2; }
watch_3 = Watch(code_block_18)

# group: Operazioni mediante nodi > %
code_block_19 = CodeBlock { 5; 2; }
mod = code_block_19.out0 % code_block_19.out1
watch_4 = Watch(mod)

# group: Operazioni mediante blocchi di codice > <=
code_block_20 = CodeBlock { 5<=2; }
watch_5 = Watch(code_block_20)

# group: Operazioni mediante blocchi di codice > >
code_block_21 = CodeBlock { 5>2; }
watch_6 = Watch(code_block_21)

# group: Operazioni mediante nodi > <=
code_block_22 = CodeBlock { 5; 2; }
le = code_block_22.out0 <= code_block_22.out1
watch_7 = Watch(le)

# group: Operazioni mediante nodi > >
code_block_23 = CodeBlock { 5; 2; }
gt = code_block_23.out0 > code_block_23.out1
watch_8 = Watch(gt)

# group: Arco mediante blocchi di codice > Input
# Crea gli input necessari:
# 1. Punto centrale
# 2. Angolo finale
code_block_24 = CodeBlock { 15; 35; }
byCoordinates_12 = Point.ByCoordinates(x=code_block_24.out0, y=code_block_24.out1)
number_slider_12 = DoubleSlider(126.947, range=0..360 step 0.1)  # graph input

# group: Arco mediante blocchi di codice > Crea l'arco mediante punto centrale, raggio e angolo.
code_block_25 = CodeBlock(center=byCoordinates_12, endAngle=number_slider_12) { Arc.ByCenterPointRadiusAngle(center,5,0,endAngle,Vector.ZAxis()); }

# group: Arco mediante blocchi di codice > Visualizza gli output
startPoint_2 = Curve.StartPoint(curve=code_block_25)
byStartPointEndPoint_3 = Line.ByStartPointEndPoint(startPoint=startPoint_2, endPoint=byCoordinates_12)
endPoint_2 = Curve.EndPoint(curve=code_block_25)
byStartPointEndPoint_4 = Line.ByStartPointEndPoint(startPoint=endPoint_2, endPoint=byCoordinates_12)

# group: Arrotondamento mediante nodi > Input
code_block_26 = CodeBlock { 3.14159; }
code_block_27 = CodeBlock { 3; }

# group: Arrotondamento mediante nodi > Arrotonda per difetto
floor = Math.Floor(number=code_block_26)
watch_9 = Watch(floor)

# group: Arrotondamento mediante nodi > Arrotonda per eccesso
ceiling = Math.Ceiling(number=code_block_26)
watch_10 = Watch(ceiling)

# group: Arrotondamento mediante nodi > Arrotonda per eccesso o per difetto
# Qualunque valore sia il più vicino
round = Math.Round(number=code_block_26)
watch_11 = Watch(round)

# group: Arrotondamento mediante nodi > Arrotonda al numero specificato di cifre
round_2 = Math.Round(number=code_block_26, digits=code_block_27)
watch_12 = Watch(round_2)

# group: Arrotondamento mediante blocchi di codice > Input
code_block_28 = CodeBlock { 3.14159; }

# group: Arrotondamento mediante blocchi di codice > Arrotonda per difetto
code_block_29 = CodeBlock(num=code_block_28) { Math.Floor(num); }
watch_13 = Watch(code_block_29)

# group: Arrotondamento mediante blocchi di codice > Arrotonda per eccesso
code_block_30 = CodeBlock(num=code_block_28) { Math.Ceiling(num); }
watch_14 = Watch(code_block_30)

# group: Arrotondamento mediante blocchi di codice > Arrotonda per eccesso o per difetto
# Qualunque valore sia il più vicino
code_block_31 = CodeBlock(num=code_block_28) { Math.Round(num); }
watch_15 = Watch(code_block_31)

# group: Arrotondamento mediante blocchi di codice > Arrotonda al numero specificato di cifre
# Descrizione <Fare doppio clic qui per modificare la descrizione del gruppo>
code_block_32 = CodeBlock(num=code_block_28) { Math.Round(num,3); }
watch_16 = Watch(code_block_32)

# group: Operazioni mediante blocchi di codice > ==(uguale a)
code_block_33 = CodeBlock { true == false; }
watch_17 = Watch(code_block_33)

# group: Operazioni mediante blocchi di codice > Non
code_block_34 = CodeBlock { !true; }
watch_18 = Watch(code_block_34)

# group: Operazioni mediante blocchi di codice > && (e)
code_block_35 = CodeBlock { true && false; }
watch_19 = Watch(code_block_35)

# group: Operazioni mediante blocchi di codice > || (o)
code_block_36 = CodeBlock { true || false; }
watch_20 = Watch(code_block_36)

# group: Operazioni mediante nodi > ==(uguale a)
boolean = BoolSelector(true)  # graph input
boolean_2 = BoolSelector(false)  # graph input
eq = boolean == boolean_2
watch_21 = Watch(eq)

# group: Operazioni mediante nodi > || (o)
boolean_3 = BoolSelector(true)  # graph input
boolean_4 = BoolSelector(false)  # graph input
or_ = boolean_3 || boolean_4
watch_22 = Watch(or_)

# group: Operazioni mediante nodi > && (e)
boolean_5 = BoolSelector(true)  # graph input
boolean_6 = BoolSelector(false)  # graph input
and_ = boolean_5 && boolean_6
watch_23 = Watch(and_)

# group: Operazioni mediante nodi > Non
boolean_7 = BoolSelector(true)  # graph input
not_ = Not(x=boolean_7)
watch_24 = Watch(not_)
