# Dynamo graph Core_PassingFunctions.dyn (Dynamo 3.1.0.3411)
# author: Dynamo Team
# Mostra come passare una funzione in Dynamo.

# group: Informazioni
# note: FUNZIONI DI PASSAGGIO
# Dynamo è un linguaggio funzionale, pertanto le azioni possono essere trattate come oggetti. Quasi tutti i nodi di Dynamo possono essere convertiti in funzioni e utilizzati in modo molto preciso per i dataset.
# Quando si crea una funzione o se ne esegue il passaggio, è come se si dicesse "Correre per 20 minuti!" specificando il soggetto in un secondo momento.
# Nell'esempio viene rappresentata una griglia di cerchi in una struttura complessa. Il comando per selezionare una serie di cerchi viene utilizzato direttamente, quindi viene passato come funzione a livelli inferiori di dati per ottenere un risultato diverso.

# group: Input iniziali
# Crea una matrice di punti 5x8.
code_block = CodeBlock { 0..#8..4; }
code_block_2 = CodeBlock { 0..#5..4; }
byCoordinates = Point.ByCoordinates(x=code_block, y=code_block_2, lacing=CrossProduct)

# group: Disegna la matrice di cerchi.
# note: L'elenco di punti è strutturato gerarchicamente: si tratta di un elenco di elenchi. La griglia è stata creata con 8 punti nella direzione X e 5 punti nella direzione Y. Rappresenta 8 elenchi di 5 elementi o elenchi di colonne di punti.
watch = Watch(byCoordinates)
code_block_3 = CodeBlock { 1.5; }
# note: Disegna un cerchio attorno ad ogni punto.
byCenterPointRadius = Circle.ByCenterPointRadius(centerPoint=watch, radius=code_block_3)

# group: Seleziona il secondo e il terzo ELENCO.
# Passaggio della funzione
code_block_4 = CodeBlock { 1..2; }
# note: Dall'elenco nidificato di cerchi vengono scelti gli elementi {1,2}. I nodi di Dynamo in un elenco si muovono sempre "dall'esterno verso l'interno", ovvero dal livello più elevato al livello più basso.
# Se si selezionano gli elementi 1 e 2 dell'elenco, vengono restituiti l'elenco numero 1 e l'elenco numero 2 della struttura dell'elenco nidificato originale.
getItemAtIndex = List.GetItemAtIndex(list=byCenterPointRadius, index=code_block_4)

# group: Estrudi SU
# Cilindri risultanti
# note: I dati selezionati sono ancora presenti nella struttura in cui erano contenuti prima di essere stati selezionati mediante mappatura.
watch_2 = Watch(getItemAtIndex)
code_block_5 = CodeBlock { 3; }
# note: L'elenco di cerchi viene estruso verso l'alto.
extrude = Curve.Extrude(curve=watch_2, distance=code_block_5)

# group: Seleziona la seconda e la terza VOCE di OGNI ELENCO.
# Passaggio della funzione
code_block_6 = CodeBlock { 1..2; }
# note: Invece di prendere i primi due elenchi dall'output del nodo, la funzionalità List@Level consente di prendere il primo e il secondo elemento di OGNI elenco, selezionando L2 nella porta di input di List.GetItemAtIndex.
# Questa funzionalità si basa su List.Map, un metodo utilizzato per accedere ai livelli interni degli elenchi di input nelle versioni precedenti di Dynamo.
getItemAtIndex_2 = List.GetItemAtIndex(list=byCenterPointRadius@L2, index=code_block_6)

# group: Estrudi GIÙ
# Cilindri risultanti
watch_3 = Watch(getItemAtIndex_2)
code_block_7 = CodeBlock { -3; }
# note: L'elenco di cerchi viene estruso verso il basso.
extrude_2 = Curve.Extrude(curve=watch_3, distance=code_block_7)
