# Dynamo graph Core_Python.dyn (Dynamo 4.1.0.2940)
# author: Dynamo Team
# Utilizzo del nodo Python in Dynamo

# group: Informazioni
# note: PYTHON
# Dynamo supporta CPython attraverso uno dei due tipi di nodi Python. Un secondo tipo di nodo Python, non illustrato di seguito, è in grado di leggere un file script da eseguire creato a partire da un file esterno.
# Fare doppio clic sul nodo per vedere lo script Python.
# L'input è contenuto nella matrice IN. L'output deve essere assegnato alla variabile OUT. L'output può essere un valore singolo o una matrice.

# group: Utilizzo del nodo Python per applicare la manipolazione dei segni all'elenco
# note: L'esempio consente di aggiungere o rimuovere tutti gli elementi di un elenco. Gli input sono rappresentati da un numero, il cui segno determina se viene utilizzata l'addizione o la sottrazione e da un elenco di numeri.

# group: Scegliere un numero positivo, 0 o negativo.
# Descrizione <Fare doppio clic qui per modificare la descrizione del gruppo>
# note: Sceglie il segno per l'operazione
#     numero < 0      sottrae ciascuno
#     numero = 0      0
#     numero > 0      aggiunge ciascuno
integer_slider = IntegerSlider(1, range=-1..2 step 1)

# group: Crea l'elenco di input.
# note: Crea un elenco qualsiasi
code_block = CodeBlock { 0..10; }
watch = Watch(code_block)

# group: Python
# Applica la manipolazione dei segni.
# note: L'output di OUT è una matrice in cui il primo elemento è un valore singolo e il secondo elemento è un elenco di valori. Tale struttura di dati è stata specificata nella definizione Python. Se si specifica una matrice, è possibile inviare un numero illimitato di output al grafico di Dynamo.
python_script = Python(Sign=integer_slider, List=watch)  # PythonNet3
# ---------- python_script.python (31 lines) ----------
# Python script to find add or subtract a series of numbers. 

# Boiler-plate import statments included out-of-the-box
import clr
clr.AddReference('ProtoGeometry')
from Autodesk.DesignScript.Geometry import *

# The inputs to this node will be stored as a list in the IN variable.
sign = IN[0]  # -1 for subtract all, 0 for do nothing, 1 for add all
nums = IN[1]  # List of numbers to subtract or add

partials = [] # Empty array to contain partial sums or differences
result = 0    # Initialize the sum or difference to 0

# Loop through each item and add it or subtract it from the result.
for index in range(len(nums)):
	if sign > 0:
		result = result + nums[index]
		partials.append(result)
	elif sign == 0:
		partials.append(result)
		continue
	else:
		result = result - nums[index]
		partials.append(result)

# Assign the output to the OUT variable
#OUT = results  # Use this to output only the result.
OUT = []
OUT.append(result)
OUT.append(partials)
# ----------------------------------------

# group: Elenco risultante
code_block_2 = CodeBlock { 1; }
getItemAtIndex = List.GetItemAtIndex(list=python_script, index=code_block_2)
# note: Serie di risultati parziali.
watch_2 = Watch(getItemAtIndex)

# group: Somma risultante
code_block_3 = CodeBlock { 0; }
getItemAtIndex_2 = List.GetItemAtIndex(list=python_script, index=code_block_3)
# note: Risultato totale.
watch_3 = Watch(getItemAtIndex_2)

# group: Creazione geometria Python
# note: Questo esempio di Python non presenta input. Mostra come creare elementi di geometria utilizzando la libreria di protogeometria di Dynamo. Poiché il nodo Python crea geometria visibile, se lo si seleziona, come avviene con qualsiasi altro nodo, la geometria verrà evidenziata.
python_script_2 = Python()  # PythonNet3
# ---------- python_script_2.python (24 lines) ----------
import clr
clr.AddReference('ProtoGeometry')
from Autodesk.DesignScript.Geometry import *
#The inputs to this node will be stored as a list in the IN variable.
dataEnteringNode = IN

p1 = Point.ByCoordinates(0, 0, 0);
p2 = Point.ByCoordinates(-10, -10, -10);

l = Line.ByStartPointEndPoint(p1, p2);

pts = [
	Point.ByCoordinates(0, 0, 0),
	Point.ByCoordinates(10, 10, 0),
	Point.ByCoordinates(20, 0, 0),
	Point.ByCoordinates(30, 10, 0),
	Point.ByCoordinates(40, 0, 0) ]
	
spline = NurbsCurve.ByPoints(pts)

surf = spline.Extrude(Vector.ByCoordinates(0, 0, 1), 10)

#Assign your output to the OUT variable
OUT = [l, spline, surf]
# ----------------------------------------

# group: Mostra l'output risultante per esaminarlo.
# note: Suggerimento: per accedere a determinati elementi di un elenco,
# utilizzare un Code Block.
code_block_4 = CodeBlock(output=python_script_2) { output[0]; output[1]; output[2]; }
watch_4 = Watch(code_block_4.out2)
watch_5 = Watch(code_block_4.out0)
watch_6 = Watch(code_block_4.out1)
