# Dynamo graph Core_RangeSyntax.dyn (Dynamo 3.0.0.6964)
# author: Dynamo Team
# Questo grafico offre diversi modi per generare serie di numeri o caratteri equidistanti.

# group: Informazioni
# note: Sintassi di Range
# Esistono diversi modi per creare elenchi come sequenze di numeri o caratteri.
# Le sequenze possono essere utili per creare matrici di elementi, iterazioni e come preparazione per varie funzioni ed equazioni.

# group: Utilizzo di Code Block
# note: start..end..step
# Da 0 a 10 con un incremento di 2
# Questo metodo è equivalente all'utilizzo del nodo Range.
code_block = CodeBlock { 0..10..2; }
watch = Watch(code_block)
# note: start..end
# Quando il valore di incremento non è specificato, si presuppone che sia pari a 1.
# Questo metodo è identico all'utilizzo del nodo Range.
# note: Utilizza la sintassi dell'intervallo in un nodo Code Block. Esistono diversi metodi per generare serie di numeri (o caratteri):
#         start..end..step
#         start..end..#amount
#         start..#amount..interval
# start = numero/carattere che inizia la serie
# numero/carattere che termina la serie
# step = differenza tra due numeri/caratteri consecutivi
# quantità di numeri/caratteri presenti nella serie
code_block_2 = CodeBlock { 0..10; }
watch_2 = Watch(code_block_2)
# note: start..end..#amount
# Da 0 a 10 in 3 incrementi
code_block_3 = CodeBlock { 0..10..#3; }
watch_3 = Watch(code_block_3)
# note: start..#amount..interval
# 10 incrementi a partire da 0, dove ogni incremento è pari a 3
# Questo metodo è equivalente all'uso del nodo Sequence.
code_block_4 = CodeBlock { 0..#10..3; }
watch_4 = Watch(code_block_4)

# group: Utilizza Code Block con un input dinamico.
integer_slider = IntegerSlider(7, range=0..10 step 1)
# note: Sostituisce un valore con una variabile e utilizza un dispositivo di scorrimento per controllare dinamicamente la lunghezza dell'elenco.
code_block_5 = CodeBlock(howMany=integer_slider) { 0..#howMany..3; }
watch_5 = Watch(code_block_5)

# group: Utilizzo di Sequence
number = DoubleInput(0)
number_slider = DoubleSlider(8, range=0..10 step 0.1)
number_2 = DoubleInput(2)
# note: Utilizzare un nodo Sequence se si conosce il numero di voci dell'elenco e la lunghezza di ciascun incremento. L'ultimo risultato dell'elenco non è predefinito, ma calcolato in base ad altri input.
# Esempio: progettazione di un parcheggio con posti per 8 auto e larghezza nota di ogni posto auto. La larghezza complessiva di tutti i posti auto dipende dalle singole larghezze e dal numero di posti.
sequence = Sequence(start=number, amount=number_slider, step=number_2, lacing=Longest)
watch_6 = Watch(sequence)

# group: Utilizzo di Range
number_3 = DoubleInput(0)
number_4 = DoubleInput(10)
number_slider_2 = DoubleSlider(1.75, range=0..10 step 0.1)
# note: Utilizzare un nodo Range se l'inizio e la fine della sequenza sono noti. Il numero di voci nell'elenco risultante non è predefinito, ma calcolato in base ad altri input.
# È bene notare che l'ultima voce dell'elenco potrebbe non corrispondere all'input end se il valore step si estende oltre tale input superandolo di un ulteriore valore step.
# Aumentando il valore step tra i valori impostati start ed end si può ottenere un numero inferiore di voci e viceversa; riducendo il valore step si aumenta la lunghezza dell'elenco.
range = Range(start=number_3, end=number_4, step=number_slider_2, lacing=Longest)
watch_7 = Watch(range)

# group: Utilizzo di Range - con le stringhe
string = StringInput("A")
string_2 = StringInput("P")
code_block_6 = CodeBlock { 1; }
# note: Range può essere utilizzato anche per generare sequenze di caratteri.
range_2 = Range(start=string, end=string_2, step=code_block_6, lacing=Longest)
watch_8 = Watch(range_2)

# group: Utilizzo di Sequence - con le stringhe
string_3 = StringInput("A")
code_block_7 = CodeBlock { 20; }
# note: Utilizzare un nodo Sequence per generare una serie di lettere in ordine alfabetico.
sequence_2 = Sequence(start=string_3, amount=code_block_7)
watch_9 = Watch(sequence_2)

# note: Utilizzare la sequenza di valori per creare una serie di punti.
byCoordinates = Point.ByCoordinates(x=code_block_5)
