# Dynamo graph Core_Strings.dyn (Dynamo 3.4.1.7055)
# author: Dynamo Team
# Questo grafico mostra le azioni che possono essere eseguite sulle stringhe.

# group: Informazioni
# note: STRINGHE
# Questo insieme di esempi illustra alcune azioni che possono essere eseguite con le stringhe. Nella libreria dei nodi, nella categoria String, sono disponibili più nodi per le operazioni di stringa.

byCoordinates = Point.ByCoordinates()
code_block = CodeBlock { 5; }
# note: Crea un oggetto, un cerchio.
byCenterPointRadius = Circle.ByCenterPointRadius(centerPoint=byCoordinates, radius=code_block)

# group: Converti oggetto in stringa
# note: Converte un oggetto in una descrizione stringa dello stesso.
string_from_object = FromObject(obj=byCenterPointRadius)

watch = Watch(string_from_object)

# group: Dividi stringa mediante separatori
code_block_2 = CodeBlock { "("; ")"; " "; "="; ","; }
# note: Divide una stringa in parti specificando uno o più caratteri di separazione. Ogni separatore può essere costituito da uno o più caratteri.
split = String.Split(string=watch, separator0=code_block_2.out0, separator1=code_block_2.out1, separator2=code_block_2.out2, separator3=code_block_2.out3, separator4=code_block_2.out4)

watch_2 = Watch(split)

# group: Verifica se la stringa contiene la sottostringa
code_block_3 = CodeBlock { "."; }
# note: Determina se una stringa contiene un'altra stringa.
contains = String.Contains(string=watch_2, searchFor=code_block_3)

watch_3 = Watch(contains)

# group: Crea stringa
# note: Utilizzare un Code Block per creare una stringa. "" contrassegna il valore stringa.
code_block_4 = CodeBlock { "Few things are harder to put up with than a good example."; }

# group: Cambia in MAIUSCOLO
string = StringInput(" - Mark Twain")
# note: Modifica le maiuscole/minuscole di una stringa
toUpper = String.ToUpper(string=string)
watch_4 = Watch(toUpper)

# group: Concatena
# note: Associa due stringhe per creare una sola stringa, denominata "concatenata".
concat = String.Concat(string0=code_block_4, string1=watch_4)

watch_5 = Watch(concat)

# group: Sostituisci caratteri in una stringa
code_block_5 = CodeBlock { "put"; }
code_block_6 = CodeBlock { "come"; }
# note: Sostituisce tutte le occorrenze di una sottostringa con una stringa sostitutiva.
replace = String.Replace(string=watch_5, searchFor=code_block_5, replaceWith=code_block_6)

watch_6 = Watch(replace)

# group: Individua una sottostringa in una stringa
code_block_7 = CodeBlock { " to"; }
# note: Trova il punto in cui si trova una sottostringa specifica in una stringa. Il risultato è l'indice in cui inizia la sottostringa.
indexOf = String.IndexOf(string=watch_6, searchFor=code_block_7)
watch_7 = Watch(indexOf)

# group: Lunghezza stringa
# note: Determina il numero totale dei caratteri inclusi in una stringa.
length = String.Length(string=watch_6)
watch_8 = Watch(length)

# note: Sottrae la prima parte della stringa dalla lunghezza totale della stringa.
sub = watch_8 - watch_7

# group: Rimuovi caratteri
# note: Rimuove un determinato numero di caratteri da una stringa.
remove = String.Remove(string=watch_6, startIndex=watch_7, count=sub)

# group: Conta occorrenze
watch_9 = Watch(remove)
code_block_8 = CodeBlock { "ar"; }
# note: Conta le occorrenze di una sottostringa all'interno di una stringa.
countOccurrences = String.CountOccurrences(string=watch_9, searchFor=code_block_8)
watch_10 = Watch(countOccurrences)

# group: Crea stringa
# note: Se la stringa include un carattere ", utilizzare un carattere di escape \ prima di " per trattarlo come parte della stringa e non fine della stringa
code_block_9 = CodeBlock { "There is no \"I\" in Team"; }
watch_11 = Watch(code_block_9)

intervallo_di_numeri = CodeBlock { 2..101; }

# group: Concatena le stringhe mediante Aggiungi.
code_block_10 = CodeBlock { " Dalmatians"; }
# note: L'operazione Aggiungi converte automaticamente i numeri in stringhe ed esegue la concatenazione.
add = intervallo_di_numeri + code_block_10
watch_12 = Watch(add)

# group: Converti oggetto in stringa
# note: In alcuni casi, è necessario convertire prima un oggetto in una stringa.
string_from_object_2 = FromObject(object=intervallo_di_numeri)
watch_13 = Watch(string_from_object_2)
type = Object.Type(object=string_from_object_2)
watch_14 = Watch(type)

# group: Converti stringa in numero
code_block_11 = CodeBlock { "101 Dalmatians"; }
code_block_12 = CodeBlock { " "; }
# note: Divide la stringa in parole utilizzando lo spazio come separatore.
split_2 = String.Split(string=code_block_11, separator0=code_block_12)
# note: Ottiene la prima voce da un elenco.
firstItem = List.FirstItem(list=split_2)
# note: Converti la stringa in un numero.
toNumber = String.ToNumber(string=firstItem)
watch_15 = Watch(toNumber)
type_2 = Object.Type(object=toNumber)
watch_16 = Watch(type_2)

# group: Converti stringhe in numeri
# note: Utilizzare l'elenco booleano come maschera per un filtro, per ottenere tutti i numeri in un elenco.
filterByBoolMask = List.FilterByBoolMask(list=watch_2, mask=contains)
# note: Converte le stringhe in numeri.
toNumber_2 = String.ToNumber(string=filterByBoolMask.in)

watch_17 = Watch(filterByBoolMask.in)
