# Dynamo graph Geometry_Curves.dyn (Dynamo 3.1.0.3411)
# author: Dynamo Team
# Un grafico di esempio che mostra come creare le primitive della curva di base: linea, policurva, curva NURBS aperta e chiusa.

# group: Informazioni
# note: Questo grafico mostra come creare le primitive della curva di base: linea, policurva, curva NURBS aperta e chiusa.

# group: Input iniziali
number = DoubleInput(5)
number_2 = DoubleInput(10)
number_3 = DoubleInput(15)

# group: 4 punti iniziali
byCoordinates = Point.ByCoordinates()
byCoordinates_2 = Point.ByCoordinates(y=number)
byCoordinates_3 = Point.ByCoordinates(x=number_2, y=number_2)
byCoordinates_4 = Point.ByCoordinates(x=number_3)

# group: Elenco di 4 punti
create = List.Create(item0=byCoordinates, item1=byCoordinates_2, item2=byCoordinates_3, item3=byCoordinates_4)

# group: Curva NURBS
# note: Crea una curva NURBS per 4 punti.
byPoints = NurbsCurve.ByPoints(points=create)

# group: Linea
# note: Linea retta singola per 2 punti
byStartPointEndPoint = Line.ByStartPointEndPoint(startPoint=byCoordinates, endPoint=byCoordinates_2)

length = Curve.Length(curve=byStartPointEndPoint)

# group: Curva NURBS - chiusa
boolean = BoolSelector(true)
# note: Crea una curva NURBS chiusa all'interno dei punti di delimitazione.
byControlPoints = NurbsCurve.ByControlPoints(points=create, closeCurve=boolean)

# group: PolyCurve
# Descrizione <Fare doppio clic qui per modificare la descrizione del gruppo>
# note: Crea una PolyCurve retta attraverso un gruppo di punti.
# note: Nuova nota
byPoints_2 = PolyCurve.ByPoints(points=create)

# group: Azioni e query
code_block = CodeBlock { 0..1..#20; }
# note: Le curve, le PolyCurve (raccolte di curve), gli elementi NURBS e le linee derivano da curve, pertanto le azioni e le query valide per le curve sono valide per tutti questi elementi
pointAtParameter = Curve.PointAtParameter(curve=byPoints_2, param=code_block)
