# Dynamo graph Geometry_Points.dyn (Dynamo 3.1.0.3411)
# author: Dynamo Team
# Crea la matrice di punti.

# group: Input iniziali
number_slider = DoubleSlider(6.4, range=0..10 step 0.1)

# group: Singolo punto
# note: Gli elementi geometrici di base hanno valori di default per gli input numerici. Controllare i valori di default posizionando il cursore sulla porta di input del nodo.
byCoordinates = Point.ByCoordinates(z=number_slider)

# group: Anteprima risultati
# note: Dopo aver premuto Esegui o con l'opzione di esecuzione Automatico attivata, l'entità geometrica viene visualizzata nell'anteprima di sfondo, in Watch 3D o come dato in un nodo Watch. Gli elementi si evidenziano sullo sfondo quando il nodo è selezionato.
watch_3d = Watch3D(byCoordinates)

# group: Input iniziali
number = DoubleInput(0)
number_2 = DoubleInput(10)
number_3 = DoubleInput(1)

# group: Intervallo di numeri
# note: È possibile creare matrici di geometria mediante sequenze, intervalli ed elenchi
range = Range(start=number, end=number_2, step=number_3, lacing=Longest)

# group: Matrice di punti
# note: Crea matrici di 1, 2 e 3 dimensioni passando gli intervalli nelle porte x, y e z dei punti, quindi modificando le proprietà Collegamento nel menu contestuale del nodo. Osservare il risultato quando si sceglie l'opzione Collegamento Prodotto cartesiano.
byCoordinates_2 = Point.ByCoordinates(x=range, y=range, lacing=CrossProduct)

watch = Watch(byCoordinates)

# group: Converte il punto in vettore.
# Descrizione <Fare doppio clic qui per modificare la descrizione del gruppo>
# note: Alcuni elementi possono essere facilmente convertiti in altri.
asVector = Point.AsVector(point=watch)

# group: Sposta la matrice per il punto come vettore.
# note: È possibile creare elementi derivati utilizzando gli strumenti disponibili nella sottocategoria Azioni dell'entità
add = Point.Add(point=byCoordinates_2, vectorToAdd=asVector)

# group: Anteprima coordinata Z del punto
# note: Le informazioni possono essere estratte dalla geometria utilizzando i nodi nella sottocategoria Query di ogni raggruppamento di nodi (accanto al simbolo del punto interrogativo).
Z = Point.Z(point=byCoordinates)
