# Dynamo graph Geometry_Solids.dyn (Dynamo 3.1.0.3411)
# author: Dynamo Team
# Un grafico di esempio di Dynamo che mostra la creazione di solidi mediante Loft e la manipolazione di solidi (addizione e sottrazione).

# group: Punti iniziali per il primo gruppo di curve
byCoordinates = Point.ByCoordinates()
number = DoubleInput(10)
byCoordinates_2 = Point.ByCoordinates(x=number)
byCoordinates_3 = Point.ByCoordinates(y=number)

# group: Punto aggiuntivo per il secondo gruppo di curve
number_2 = DoubleInput(5)
byCoordinates_4 = Point.ByCoordinates(z=number_2)

# group: Crea le curve iniziali per la base inferiore.
byStartPointEndPoint = Line.ByStartPointEndPoint(startPoint=byCoordinates, endPoint=byCoordinates_2)
byThreePoints = Arc.ByThreePoints(firstPoint=byCoordinates, secondPoint=byCoordinates_4, thirdPoint=byCoordinates_2)

# group: Crea la base inferiore.
create = List.Create(item0=byStartPointEndPoint, item1=byThreePoints)
byJoinedCurves = PolyCurve.ByJoinedCurves(curves=create)

# group: Punto aggiuntivo per il terzo gruppo di curve
number_3 = DoubleInput(15)
byCoordinates_5 = Point.ByCoordinates(x=number_3, y=number_3)

# group: Punto aggiuntivo per il quarto gruppo di curve
number_4 = DoubleInput(5)
number_5 = DoubleInput(10)
byCoordinates_6 = Point.ByCoordinates(x=number_4, y=number_5, z=number_5)

# group: Crea le curve iniziali per la base superiore.
byStartPointEndPoint_2 = Line.ByStartPointEndPoint(startPoint=byCoordinates_3, endPoint=byCoordinates_5)
byThreePoints_2 = Arc.ByThreePoints(firstPoint=byCoordinates_3, secondPoint=byCoordinates_6, thirdPoint=byCoordinates_5)

# group: Crea la base superiore.
create_2 = List.Create(item0=byStartPointEndPoint_2, item1=byThreePoints_2)
byJoinedCurves_2 = PolyCurve.ByJoinedCurves(curves=create_2)

# group: Combina le curve di base in un elenco.
create_3 = List.Create(item0=byJoinedCurves, item1=byJoinedCurves_2)

# group: Loft
# note: Per la maggior parte dei solidi sono disponibili diversi metodi di creazione. Gli esempi illustrano profili chiusi come base, tuttavia le PolySurface possono essere unite e sono disponibili numerose primitive (superfici, cuboidi, coni e così via)
byLoft = Solid.ByLoft(crossSections=create_3)

# group: Volume
# note: È possibile controllare il volume del loft, verificando che si tratta di una geometria solida chiusa.
volume = Solid.Volume(solid=byLoft)

# group: Punto aggiuntivo per la geometria di loft aggiuntiva
number_6 = DoubleInput(-2)
number_7 = DoubleInput(5)
byCoordinates_7 = Point.ByCoordinates(x=number_6, y=number_7)

# group: Combina i punti in un elenco.
create_4 = List.Create(item0=byCoordinates, item1=byCoordinates_7, item2=byCoordinates_3)

# group: Crea la curva di base aggiuntiva.
# Descrizione <Fare doppio clic qui per modificare la descrizione del gruppo>
# note: Questa volta crea una curva NURBS dal gruppo di punti.
byPoints = NurbsCurve.ByPoints(points=create_4)

# group: Loft +
# note: Suggerimento: disattivare l'anteprima nei menu di scelta rapida dei nodi per escludere elementi dalla visualizzazione
byLoft_2 = Solid.ByLoft(crossSections=create_3, guideCurves=byPoints)

# group: Geometria +
code_block = CodeBlock { Vector.ByCoordinates(-20,0,0); }
# note: Sposta la geometria per visualizzare l'output.
translate = Geometry.Translate(geometry=byLoft_2, direction=code_block)

# group: Prepara gli "ingredienti" per tagliare la geometria solida.
# note: Spessore
code_block_2 = CodeBlock { 0; }
# note: Suggerimento: disattivare l'anteprima nei menu di scelta rapida dei nodi per escludere elementi dalla visualizzazione
thinShell = Solid.ThinShell(solid=byLoft, internalFaceThickness=code_block_2)
code_block_3 = CodeBlock { Vector.ByCoordinates(20,0,0); }
# note: Sposta la geometria nella direzione X di 20 unità.
translate_2 = Geometry.Translate(geometry=thinShell, direction=code_block_3)
code_block_4 = CodeBlock { Point.ByCoordinates(0,0,5); }
ZAxis = Vector.ZAxis()
# note: Crea un piano che attraversa il solido da tagliare.
byOriginNormal = Plane.ByOriginNormal(origin=code_block_4, normal=ZAxis)
# note: Questo punto determina quale parte del solido tagliare.
code_block_5 = CodeBlock { Point.ByCoordinates(10,10,10); }

# group: Loft -
# note: Le operazioni booleane geometriche (intersezione, differenza, unione e così via) sono disponibili nella categoria Geometria.
trim = Geometry.Trim(geometry=translate_2, other=byOriginNormal, pick=code_block_5)
