# Dynamo graph Geometry_Surfaces.dyn (Dynamo 3.1.0.3411)
# Un grafico di Dynamo che mostra i metodi principali di creazione delle superfici: Estrudi, Loft ed Estrusione su percorso.

# group: Informazioni
# note: Un grafico di Dynamo che mostra i metodi principali di creazione delle superfici: Estrudi, Loft ed Estrusione su percorso

# group: Input
number = DoubleInput(10)
number_2 = DoubleInput(-10)
byCoordinates = Point.ByCoordinates(x=number, y=number_2)
byCoordinates_2 = Point.ByCoordinates(y=number_2)

# group: Linea
byStartPointEndPoint = Line.ByStartPointEndPoint(startPoint=byCoordinates, endPoint=byCoordinates_2)

# group: Input
byCoordinates_3 = Point.ByCoordinates()

# group: Input
number_3 = DoubleInput(5)
byCoordinates_4 = Point.ByCoordinates(z=number_3)

# group: Input
number_4 = DoubleInput(10)
byCoordinates_5 = Point.ByCoordinates(x=number_4)
byCoordinates_6 = Point.ByCoordinates(y=number_4)

# group: Arco
byThreePoints = Arc.ByThreePoints(firstPoint=byCoordinates_3, secondPoint=byCoordinates_4, thirdPoint=byCoordinates_5)

# group: Loft
create = List.Create(item0=byStartPointEndPoint, item1=byThreePoints)
# note: Utilizzando i 2 gruppi di curve, è possibile creare una geometria di loft tra di essi
byLoft = Surface.ByLoft(crossSections=create)

# group: Valuta area loft
area = Surface.Area(surface=byLoft)
watch = Watch(area)

# group: Input
number_5 = DoubleInput(5)
number_6 = DoubleInput(10)
byCoordinates_7 = Point.ByCoordinates(x=number_5, y=number_6, z=number_6)

# group: Input
number_7 = DoubleInput(15)
byCoordinates_8 = Point.ByCoordinates(x=number_7, y=number_7)

# group: Arco
byThreePoints_2 = Arc.ByThreePoints(firstPoint=byCoordinates_6, secondPoint=byCoordinates_7, thirdPoint=byCoordinates_8)

# group: Input
number_8 = DoubleInput(-5)
number_9 = DoubleInput(5)
byCoordinates_9 = Point.ByCoordinates(x=number_8, y=number_9)

# group: Arco
byThreePoints_3 = Arc.ByThreePoints(firstPoint=byCoordinates_3, secondPoint=byCoordinates_9, thirdPoint=byCoordinates_6)

# group: Estrusione su percorso
# note: Per la maggior parte delle superfici sono disponibili diversi metodi di creazione. Le superfici, le PolySurface (ovvero le raccolte di superfici) e le superfici NURBS possono essere create in base a punti o curve e possono derivare da altre superfici o solidi
bySweep2Rails = Surface.BySweep2Rails(path=byThreePoints_2, guideRail=byThreePoints, profile=byThreePoints_3)

# group: Combina loft ed estrusione su percorso
create_2 = List.Create(item0=byLoft, item1=bySweep2Rails)
# note: Le superfici unite come PolySurface possono essere valutate come se si trattasse di un'entità singola
byJoinedSurfaces = PolySurface.ByJoinedSurfaces(surfaces=create_2)

# group: Valuta area combinata loft + estrusione su percorso
area_2 = Surface.Area(surface=byJoinedSurfaces)
watch_2 = Watch(area_2)

# group: Valuta area estrusione su percorso
area_3 = Surface.Area(surface=bySweep2Rails)
watch_3 = Watch(area_3)

# group: Estrai e usa punti dalla superficie
code_block = CodeBlock { 0..1..0.1; }
# note: I bordi, i punti e altre funzionalità possono essere derivati da superfici utilizzando operazioni appropriate per tali geometrie
pointAtParameter = Surface.PointAtParameter(surface=bySweep2Rails, u=code_block, v=code_block, lacing=CrossProduct)
# note: Crea una nuova superficie NURBS mediante i parametri (punti) estratti.
# Nascondere le altre geometrie per osservare il risultato di quella riportata qui sotto.
byControlPoints = NurbsSurface.ByControlPoints(controlVertices=pointAtParameter)
watch_3d = Watch3D(byControlPoints)

# group: Estrudi
code_block_2 = CodeBlock { 10; }
# note: Un'estrusione di base dalla curva fornita
extrude = Curve.Extrude(curve=byThreePoints_2, distance=code_block_2)
