# Dynamo graph ImportExport_CSV to Stuff.dyn (Dynamo 3.1.0.3411)
# author: Dynamo Team
# Crea geometria basata su dati .csv analizzati.

# group: Input iniziale helix.csv
# note: Consente di consultare un file CSV contenente numeri nello spazio coordinate X, Y, Z
file_path = Filename("..\..\Data\helix.csv")

# group: Legge il file.
fromPath = FileObject(path=file_path)  # "File.FromPath"
readText = FileSystem.ReadText(file=fromPath)

# group: Analizza i dati .csv.
string = StringInput("\n")
# note: Divide la stringa in corrispondenza di un ritorno a capo <INVIO>
split = String.Split(string=readText, separator0=string)
string_2 = StringInput(",")
# note: Divide la stringa in corrispondenza di una virgola
split_2 = String.Split(string=split, separator0=string_2)
# note: I file CSV forniscono stringhe, non numeri
toNumber = String.ToNumber(string=split_2)
# note: Raggruppa i componenti X, Y e Z
transpose = List.Transpose(lists=toNumber)

# group: Creare la geometria "a spirale" in base ai punti recuperati dal file .csv.
# note: Coordinata X
firstItem = List.FirstItem(list=transpose)
code_block = CodeBlock { 1; }
# note: Coordinata Y
getItemAtIndex = List.GetItemAtIndex(list=transpose, index=code_block)
# note: Coordinata Z
lastItem = List.LastItem(list=transpose)
byCoordinates = Point.ByCoordinates(x=firstItem, y=getItemAtIndex, z=lastItem)

# group: Aumenta la scala.
number_slider = DoubleSlider(2.337, range=0..20 step 0.1)
# note: Regola la distribuzione complessiva dei punti di coordinate
scale = Geometry.Scale(geometry=byCoordinates, amount=number_slider, lacing=Longest)
