# Dynamo graph ImportExport_Excel to Dynamo.dyn (Dynamo 3.1.0.3411)
# author: Dynamo Team
# Un grafico di esempio che mostra come importare in Dynamo i dati provenienti da Excel.

# group: Input iniziali
# note: Individua il percorso del file Excel .xlsx da cui caricare i dati.
file_path = Filename("..\..\Data\helix.xlsx")
# note: Ottiene il file dal relativo percorso.
fromPath = FileObject(path=file_path)  # "File.FromPath"
# note: Il nome del foglio di lavoro in Excel che contiene i dati che si desidera importare.
string = StringInput("helix")

# group: Importa i dati di Excel.
# note: Questo nodo è in grado di leggere i dati provenienti dal foglio di lavoro di Excel. Leggerà da tutte le colonne e le righe, i cui dati risultanti saranno contenuti in una matrice doppia ([][]).
importExcel = Data.ImportExcel(file=fromPath, sheetName=string)

# group: Trasponi
# note: Inverte (traspone) l'elenco (la matrice). Le colonne diventano righe e le righe colonne.
transpose = List.Transpose(lists=importExcel)

# group: Estrae le coordinate dei punti.
number = DoubleInput(0)
# note: Coordinata X
getItemAtIndex = List.GetItemAtIndex(list=transpose, index=number)
number_2 = DoubleInput(1)
# note: Coordinata Y
getItemAtIndex_2 = List.GetItemAtIndex(list=transpose, index=number_2)
number_3 = DoubleInput(2)
# note: Coordinata Z
getItemAtIndex_3 = List.GetItemAtIndex(list=transpose, index=number_3)

# group: Crea l'elica in base ai dati estratti da Excel.
byCoordinates = Point.ByCoordinates(x=getItemAtIndex, y=getItemAtIndex_2, z=getItemAtIndex_3, lacing=Longest)
