# Dynamo graph OpenXMLExport_Data To Excel.dyn "OpenXMLExport_Data a Excel" (Dynamo 3.0.3.7594)
# author: Dynamo Team
# Un grafico di esempio di Dynamo che mostra come esportare i dati in Excel.

# group: Input iniziali
# note: Determina il numero di punti, che possono essere considerati come l'altezza dell'elica.
number_slider = DoubleSlider(1.7, range=0..5 step 0.1)

# group: Crea l'elica.
# note: Crea una serie di numeri, a partire da 0. L'incremento è 10. Il numero di punti viene moltiplicato per 360. Pertanto, se l'input numCircles è 1, il risultato è 37 numeri (da 0 a 360) e si otterrà una rivoluzione completa dell'elica.
code_block = CodeBlock(numCircles=number_slider) { 0..(360*numCircles)..10; }
# note: funzione coseno
cos = Math.Cos(angle=code_block, lacing=Longest)
# note: funzione seno
sin = Math.Sin(angle=code_block, lacing=Longest)
# note: dividi per 100
code_block_2 = CodeBlock(x=code_block) { x/100; }
# note: Crea un elenco di punti, dove il componente X è il coseno, Y è il seno e Z è il valore iniziale diviso per 100.
byCoordinates = Point.ByCoordinates(x=cos, y=sin, z=code_block_2, lacing=Longest)
# note: Crea una struttura di elenco dall'elenco di punti. Il risultato è un elenco contenente 3 elenchi ([][] - matrice doppia), ciascuno contenente rispettivamente le coordinate dei punti X, Y e Z.
code_block_3 = CodeBlock(pt=byCoordinates) { [pt.X,pt.Y,pt.Z]; }

# group: Crea gli input per l'esportazione.
# 1. Il percorso del file .csv.
# 2. Il nome del foglio di lavoro.
# 3. L'elenco trasposto di punti.
# 4. L'indice iniziale per la riga e la colonna in Excel.
# note: Il percorso del file .xlsx.
file_path = Filename("..\..\Data\icosohedron_points.xlsx")
# note: Il nome del foglio di lavoro in Excel.
string = StringInput("helix")
# note: Inverte la matrice (traspone l'elenco). Le colonne diventeranno righe e le righe colonne.
transpose = List.Transpose(lists=code_block_3)
# note: Il numero di colonne/righe per iniziare a registrare i dati in Excel
number = DoubleInput(0)

# group: Esporta i dati in un file di Excel.
# note: Esporta i dati in Excel.
openXMLExportExcel = Data.OpenXMLExportExcel(filePath=file_path, sheetName=string, data=transpose, startRow=number, startColumn=number)
