# Dynamo graph OpenXMLImport_Data From Excel.dyn "OpenXMLImport_Data da Excel" (Dynamo 3.1.0.3411)
# author: Dynamo Team
# Un grafico di esempio che mostra come importare i dati da un file Excel.

# group: Input iniziali
# 1. Il percorso del file Excel.
# 2.Il nome del foglio di lavoro.
file_path = Filename("..\..\Data\helix.xlsx")
string = StringInput("helix")

# group: Estrae i dati da Excel.
# note: Legge i dati da Excel.
openXMLImportExcel = Data.OpenXMLImportExcel(filePath=file_path, sheetName=string)

# group: Analizza i dati da Excel.
# L'analisi dei dati è il processo di manipolazione di un'origine dati in modo da renderla nativa nell'ambiente prima di utilizzarla.
# note: Traspone l'elenco (inverte la matrice). Le colonne diventeranno righe e le righe colonne.
transpose = List.Transpose(lists=openXMLImportExcel)
# note: primo elenco
number = DoubleInput(0)
# note: secondo elenco
number_2 = DoubleInput(1)
# note: terzo elenco
number_3 = DoubleInput(2)

# group: Crea l'elica.
# note: Coordinata X
getItemAtIndex = List.GetItemAtIndex(list=transpose, index=number)
# note: Coordinata Y
getItemAtIndex_2 = List.GetItemAtIndex(list=transpose, index=number_2)
# note: Coordinata Z
getItemAtIndex_3 = List.GetItemAtIndex(list=transpose, index=number_3)
byCoordinates = Point.ByCoordinates(x=getItemAtIndex, y=getItemAtIndex_2, z=getItemAtIndex_3, lacing=Longest)
