# Dynamo graph Basics_Basic01.dyn (Dynamo 2.19.3.6543)
# author: Dynamo Team
# ノードを接続して 2 つの数値を加算します

# note: Number や String などの基本的な関数の入力は、キャンバスの左側のライブラリを参照、検索して選択できます。
# 数学的な変換や幾何学的な変換といったデータに対して実行する操作もライブラリにあります
# note: Dynamo はビジュアル プログラミング言語です。他の言語と同じように、簡単な要素をつなげることでより複雑な概念を形成します
# note: Number ノードの[>]ポートからコネクタを引き出し、それを + ノードの[y]ポートに接続し、アプリケーションの左下にある[実行]ボタンをクリックします。
number = DoubleInput(2)  # graph input
add = number + _  # unwired: y
# note: アプリケーションの右下にある[実行]ボタンをクリックすると、データを視覚化できます。[自動実行]モードを有効にすると、アプリケーションは常に更新されます。
# Watch ノードを使用するか、ほとんどのノードの下部にある小さい四角をクリックすると、データを表示できます。
watch = Watch(add)
# note: [ヘルプ]メニューからはその他のサンプル ファイルを使用できます。タブの[X]をクリックしてファイルを閉じると、[ようこそ]ページに戻ります
number_2 = DoubleInput(6)  # graph input
