# Dynamo graph Basics_Basic02.dyn (Dynamo 2.19.3.6543)
# author: Dynamo Team
# 2 点を接続して線分を作成します

# note: Dynamo 環境で点の位置を操作: Point.ByCoordinates ノードを選択し、背景プレビューに切り替えて、3 つの軸に沿って点を引きます。
byCoordinates = Point.ByCoordinates()
# note: ジオメトリ データは文字情報として、または 3D 空間で視覚化できます
watch = Watch(byCoordinates)
number = DoubleInput(2)  # graph input
# note: Number Slider ノードまたは Integer Slider ノードを使用して、指定した範囲内の値を動的に入力します。数値の範囲設定を開くには、青色のドロップダウン矢印をクリックします。
number_slider = DoubleSlider(4.43, range=0..10 step 0.1)  # graph input
# note: 画面の右上コーナーにあるボタン([Ctrl] + [B]ショートカット)を使用して、3D 背景ナビゲーションとグラフ ビューのナビゲーションを切り替えることができます。Dynamo と Revit の場合は、[表示]メニューで背景プレビューのオン/オフを切り替えることもできます。
byCoordinates_2 = Point.ByCoordinates(x=number, z=number_slider)
byStartPointEndPoint = Line.ByStartPointEndPoint(startPoint=byCoordinates_2, endPoint=byCoordinates)
# note: Watch 3D ノードを使用して 3D 要素を単独で視覚化します
watch_3d = Watch3D(byStartPointEndPoint)
