# Dynamo graph Basics_Basic03.dyn (Dynamo 2.19.3.6543)
# author: Dynamo Team
# シンプルなリストを作成します

# group: 入力
# note: シーケンスと範囲を指定することによりデータのリストを生成することができます。他の多くのノードを使用すると、これらのリストを特定の目的に合わせて整理しなおすことができます。
number = DoubleInput(0)  # graph input
number_2 = DoubleInput(9)  # graph input
number_3 = DoubleInput(1)  # graph input

# note: 指定された Step で、Start から End まで一連の番号を作成します
range = Range(start=number, end=number_2, step=number_3, lacing=Longest)
watch = Watch(range)
number_4 = DoubleInput(3)  # graph input
# note: 3 の長さでリストをスライスします
chop = List.Chop(list=range, lengths=number_4)
# note: 結果をプレビューし、Watch ノードのヘルプを使用してリスト構造を確認します。
watch_2 = Watch(chop)
# note: リストの最後の項目を取得します
lastItem = List.LastItem(list=range)
watch_3 = Watch(lastItem)
