# Dynamo graph Core_AttractorPoint.dyn (Dynamo 3.0.0.6964)
# author: Dynamo Team
# このグラフにより、円柱のグリッドを作成できます。サイズはアトラクタ点の位置によって決定されます。

# group: 情報
# note: アトラクタ点
# アトラクタ点は、システム内の他の要素の特性に影響を与える参照点(または要素)です。アトラクタ点は多くの場合、磁石のように機能します。要素がアトラクタに近づくほど、アトラクタの影響を受けやすくなります。
# この例の円柱の高さと直径は、各円柱と周囲を移動するアトラクタ点の距離によって決定されます。アトラクタ点の周りの円柱は、遠くの円柱よりも小さくなります。
# この動作を視覚化するには、アトラクタ点の入力の 2 つの数値スライダを動かします。
# アトラクタ点は、設計プロセスに応答性と動的動作のレベルを導入する方法です。

# group: 点のグリッド サイズ
# note: Code Block を使用して、一連の番号を作成します。この場合、シーケンスは 1 から 50 までの番号、各ステップが 5 の n ステップで作成されます。
数値範囲 = CodeBlock { 1..50..5; }

# group: 点群のグリッドを作成します
# note: 点群のグリッド。
# 作成するには、一連の数値を X 座標と Y 座標の 2 つのポートに渡します。ノードを右クリックして、レーシングを[外積]に変更します。
# note: ノードの外積レーシングは、1 つのリストの各項目を他のリストの各項目と組み合わせて、グリッド状のリスト構造を作成します。'Point.ByCoordinates' ノードの X および Y 入力と併用すると、結果は点のフラットなグリッドになります。3 番目の Z 座標を使用すると、結果は立方体状の点のグリッドになります。
byCoordinates = Point.ByCoordinates(x=数値範囲, y=数値範囲, lacing=CrossProduct)

# group: リスト構造を平坦化
# 点を使用して追加操作を行う場合、複雑なリスト構造は不要です。Flatten により 1 つのリストのみを生成できます。
# note: 行と列の階層が不要なため、リストを平坦化します。このノードへの入力を出力と比較します。N 個のリストの構造が 1 つのリストに変更されます。
flatten = List.Flatten(list=byCoordinates)

# group: アトラクタ点の位置
number_slider = DoubleSlider(24.6, range=-10..60 step 0.1)  # graph input
number_slider_2 = DoubleSlider(11.50111001, range=-10..60 step 0.1)  # graph input
# note: アトラクタ点。この点の位置を調整するには、入力スライドを移動します。
byCoordinates_2 = Point.ByCoordinates(x=number_slider, y=number_slider_2)

# group: アトラクタまでの距離
# note: 円柱のアトラクタ点と各基準点の間の距離を求めます。
distanceTo = Geometry.DistanceTo(geometry=flatten, other=byCoordinates_2)

# group: 半径と高さを生成
# note: 円柱の高さをアトラクタ点の位置に対応させる式です。この例では、各円柱の高さはアトラクタ点までの距離の半分です。別の式を試してください。
円柱の高さ = CodeBlock(x=distanceTo) { x/2; }
# note: 式は、円柱の半径として使用される値を返します。距離が長いほど、各円柱の半径が大きくなります。別の式を試してください。
円柱の半径 = CodeBlock(x=distanceTo) { x/15; }

# group: 終点
# 各円柱の始点(原点)を、式で定義された指定の高さで移動します。
# note: 指定した値で基準点(原点)を上に移動するベクトル
byCoordinates_3 = Vector.ByCoordinates(z=円柱の高さ)
# note: この新しい Z 値(高さ)を元のグリッド点に追加して、円柱の上部の点を取得します。
add = Point.Add(point=flatten, vectorToAdd=byCoordinates_3)

# group: 円柱を作成
# note: 指定した始点、終点、半径をもつ円柱を作成するメソッドを使用します。
byPointsRadius = Cylinder.ByPointsRadius(startPoint=flatten, endPoint=add, radius=円柱の半径)
