# Dynamo graph Core_CodeBlocks.dyn (Dynamo 3.4.1.7055)
# author: Dynamo Team
# このグラフにより、Code Block のさまざまな用途やアプリケーションを検討できます。

# group: 情報
# note: CODE BLOCKS
# Code Block は、キャンバス内でダブルクリックして作成できます。Code Block ノードは、[Script] > [Editor] カテゴリの下のノード ライブラリにもあります。
# Code Block には次の値を保持できます。
# ・数値(整数と浮動小数点数)
# ・文字列(テキスト)
# ・ブール値(True または False)
# ・リスト[0,1,2]
# ・式(a+3)
# ・変数。
# 他のノードは Code Block 式に変換できます。1 つ以上のノードを選択し、ノード間のスペースを右クリックして[ノードをコード化]を選択します。この操作に相当する逆の操作はなく、Code Block を自動的にノードに変換することはできません。

# group: Code Block としてのノード
# note: Code Block を使用して、ライブラリ内の他のノードを呼び出すことができます。ライブラリ内のノードは、通常、次の 3 つのタイプで構成されます。
#     Create:	何かを作成します
#     Action:	何かに対してアクションを実行します
#     Query:		既に存在する何かのプロパティを取得し		ます
# これらの 3 つのタイプのメソッド(ノード)では、Code Block で呼び出されるときの処理がそれぞれ異なります。

# group: ジオメトリの作成
# note: これらのステートメントがまとまって、基準点にらせん曲線を作成するアルゴリズムを形成します。
code_block = CodeBlock()
# ---------- code_block.designscript (16 lines) ----------
// Basic inputs
base = Point.ByCoordinates(3,3);
coils = 3;
height = 5;
rad = 0.5;

// Make a series of points
numPts = 8*coils + 1;
seq = 0..(coils*360)..#numPts;
x = rad * Math.Cos(seq);
y = rad * Math.Sin(seq);
z = 0..height..#numPts;
pts = Point.ByCoordinates(x + base.X, y + base.Y, z + base.Z);

// Pass a curve through those points
NurbsCurve.ByPoints(pts);
# ----------------------------------------
# note: 名前を設定し、入力と戻り値を指定して、らせんアルゴリズムを関数に変換します。
code_block_2 = CodeBlock()
# ---------- code_block_2.designscript (13 lines) ----------
def MakeSpring(base,coils,height,rad)
{
// Make a series of points
numPts = 8*coils + 1;
seq = 0..(coils*360)..#numPts;
x = rad * Math.Cos(seq);
y = rad * Math.Sin(seq);
z = 0..height..#numPts;
pts = Point.ByCoordinates(x + base.X, y + base.Y, z + base.Z);

// Return the curve that passes through those points
return = NurbsCurve.ByPoints(pts);
};
# ----------------------------------------
code_block_3 = CodeBlock { 0..6..2; }
code_block_4 = CodeBlock { 10..20..2; }
# note: 任意の名前「MakeSpring」を持つ関数を設定するために、らせんアルゴリズムを変換します。この関数は、複数のスプリングを作成して、高さをランダムに設定し、通芯に配置するために呼び出されます。
# note: 通芯を作成します
byCoordinates = Point.ByCoordinates(x=code_block_3, y=code_block_4, lacing=CrossProduct)
flatten = List.Flatten(list=byCoordinates)
code_block_5 = CodeBlock { 5; }
count = List.Count(list=flatten)
# note: ばねの高さに一連のランダムな数値(5 倍にしたもの)を設定します
randomList = Math.RandomList(amount=count)
code_block_6 = CodeBlock(random=randomList) { random * 5; }
# note: 関数呼び出しへの入力は項目のリストまたは単一値の項目で作成できます。すべてのスプリングの "0.5" の半径の場合と同じように、データはポートを介して渡すか、直接宣言することができます。
code_block_7 = CodeBlock(basePoints=flatten, numCoils=code_block_5, height=code_block_6) { MakeSpring(basePoints,numCoils,height,0.5); }

# group: 関数
# note: 関数を Code Block ノードで直接設定すると、この設定のあらゆる場所で呼び出すことができます。
# 最初の行はキーワード「def」を持ち、関数名、括弧内の入力の順になります。
# 中括弧は関数の本体を設定します。それぞれの行の最後にはセミコロンを使用します。
# 「return =」で値を返します。
code_block_8 = CodeBlock()
# ---------- code_block_8.designscript (11 lines) ----------
/* This is a multi-line comment,
     which continues for mulitple
     lines. */

def FunctionName(input1, input2)
{
// This is a comment
sum = input1 + input2;

return = sum;
};
# ----------------------------------------
code_block_9 = CodeBlock { 1; }
# note: 他の Code Block ノードから呼び出されるため、関数を設定する Code Block ノードは入力ポートや出力ポートを持ちません。
code_block_10 = CodeBlock { 2; }
# note: 同じ名前と同じ引数の数を指定し、同じファイル内の別の Code Block ノードで関数を呼び出します。
code_block_11 = CodeBlock(in1=code_block_9, in2=code_block_10) { FunctionName(in1,in2); }
watch = Watch(code_block_11)
code_block_12 = CodeBlock { "cat"; }
code_block_13 = CodeBlock { "dog"; }
# note: 入力引数のタイプが関数の設定に指定されていないため、受け取ったすべての引数を処理します。
code_block_14 = CodeBlock(in1=code_block_12, in2=code_block_13) { FunctionName(in1,in2); }
watch_2 = Watch(code_block_14)
origin = Point.Origin()
code_block_15 = CodeBlock { 16; }
# note: 関数が理解できない入力を持つ関数呼び出しの結果は NULL になります。
code_block_16 = CodeBlock(in1=origin, in2=code_block_15) { FunctionName(in1,in2); }
watch_3 = Watch(code_block_16)

# group: 数値
# 専用ノードを Code Block ノードと比較します。
# note: 専用
number = DoubleInput(3.14)
結果 = Watch(number)
# note: Code Block
code_block_17 = CodeBlock { 3.140; }
watch_4 = Watch(code_block_17)

# group: 文字列値
# 専用ノードを Code Block ノードと比較します。
# note: 専用
string = StringInput("Less is more.")
結果_2 = Watch(string)
# note: 引用符 "" を使用して、Code Block ノードで文字列を作成する
code_block_18 = CodeBlock { "Less is more."; }
watch_5 = Watch(code_block_18)
# note: このノードを使用して、出力値のタイプを表示します。
type = Object.Type(object=code_block_18)
watch_6 = Watch(type)

# group: 式
# 専用 * ノードの使用および Code Block の使用で、乗算演算を実行します。
number_2 = DoubleInput(3)
number_3 = DoubleInput(5)
# note: * ノードを使用して、2 つの数値を乗算します。
mul = number_2 * number_3
結果_3 = Watch(mul)
# note: Code Block 使用して、乗算を実行します。
code_block_19 = CodeBlock { 3*5; }
watch_7 = Watch(code_block_19)
code_block_20 = CodeBlock { 3; }
code_block_21 = CodeBlock { 5; }
# note: 乗算演算の入力として変数を使用します。
code_block_22 = CodeBlock(a=code_block_20, b=code_block_21) { a*b; }
watch_8 = Watch(code_block_22)

# group: クエリー
# オブジェクトのプロパティを取得および返すメソッド
# note: Code Block を使用すると、入力の指定方法をさまざまな方法で設定できます。たとえば、同じ点を作成する場合も、いくつかの方法を使用できます。
code_block_23 = CodeBlock { 10; }
code_block_24 = CodeBlock { -10; }
# note: Point.ByCoordinates ノードを使用する設定済みのメソッド
byCoordinates_2 = Point.ByCoordinates(x=code_block_23, y=code_block_24)
watch_9 = Watch(byCoordinates_2)
# note: Code Block ノードは、X、Y、Z の 3 つの変数を持つ Point.ByCoordinates メソッドを使用します。Z は、同じ Code Block ノード内で定義され、セミコロン ';' で区切られます。
code_block_25 = CodeBlock(x=code_block_23, y=code_block_24) { z = 0; Point.ByCoordinates(x,y,z); }
watch_10 = Watch(code_block_25.out1)
code_block_26 = CodeBlock { Point.ByCoordinates(10,0,0); }
# note: 同じメソッドに相当する Code Block。クエリー メソッドに括弧は不要です。
code_block_27 = CodeBlock(pt=code_block_26) { pt.X; }
watch_11 = Watch(code_block_27)
# note: 点の X 座標を返す設定済みのクエリー メソッド
X = Point.X(point=code_block_26)
watch_12 = Watch(X)
# note: ここで同じ数値の負の値を使用する式は、入力変数の表記に統合されています。
code_block_28 = CodeBlock(num=code_block_23) { Point.ByCoordinates(num,-num,0); }
watch_13 = Watch(code_block_28)
# note: Code Block ノードで Point.ByCoordinates メソッドを使用すると、3 つの変数すべてが入力として指定されます。
code_block_29 = CodeBlock { Point.ByCoordinates(10,-10,0); }
watch_14 = Watch(code_block_29)

# group: 作成
# ジオメトリ、リスト、Revit 要素、またはその他のオブジェクトを作成するメソッド
# note: 原点を作成する設定済みのメソッド
origin_2 = Point.Origin()
watch_15 = Watch(origin_2)
# note: このメソッドには入力は不要ですが、括弧が必要です。
code_block_30 = CodeBlock { Point.Origin(); }
watch_16 = Watch(code_block_30)
code_block_31 = CodeBlock { 0; -10; }
# note: X 座標と Y 座標を指定して、点を作成する設定済みのメソッド
byCoordinates_3 = Point.ByCoordinates(x=code_block_31.out0, y=code_block_31.out1)
watch_17 = Watch(byCoordinates_3)
# note: Code Block を使用して、Point.ByCoordinates ノードの動作を複製します。元の設定済みノードの上にマウスを置くと、メソッド名が表示されます。メソッドは、ツールチップ ウィンドウの下部に表示されます。
# 入力は、設定済みノードを先に指定する必要があります。
code_block_32 = CodeBlock { Point.ByCoordinates(0,-10); }
watch_18 = Watch(code_block_32)

# group: アクション
# オブジェクトに対してアクションを実行するメソッド
origin_3 = Point.Origin()
ZAxis = Vector.ZAxis()
# note: 点にベクトルを追加する設定済みのメソッド
add = Point.Add(point=origin_3, vectorToAdd=ZAxis)
watch_19 = Watch(add)
origin_4 = Point.Origin()
ZAxis_2 = Vector.ZAxis()
# note: Action メソッドはオブジェクトに対して実行されます。オブジェクト自体の後にドット表記を使用し、最初の入力を除いて、メソッドおよび設定済みノードにあるすべての入力を指定します(最初の入力ポートはオブジェクト自体であり、既に存在しています)。
code_block_33 = CodeBlock(pt=origin_4, vector=ZAxis_2) { pt.Add(vector); }
watch_20 = Watch(code_block_33)

# group: リストを作成
# note: 角括弧を使用してリストを定義し、コンマを使用して個々の要素を区切ってリストを作成します
code_block_34 = CodeBlock { ["San Francisco","New York","Chicago"]; }
watch_21 = Watch(code_block_34)
# note: 次の表記法を使用してリストから項目を取得します: リスト[ i ]の i は項目のインデックスを表します。このメソッドは、GetItemAtIndex ノードを使用する場合と同じです。
code_block_35 = CodeBlock(cities=watch_21) { cities[2]; }
watch_22 = Watch(code_block_35)
# note: Multiple variables are defined in this code block, and at the end, a list is created containing all of them.
code_block_36 = CodeBlock()
# ---------- code_block_36.designscript (7 lines) ----------
str0 = "alpha";
str1 = "beta";
str2 = "charlie";
str3 = "delta";
str4 = "echo";
//
[str0,str1,str2,str3,str4];
# ----------------------------------------
watch_23 = Watch(code_block_36.out5)
code_block_37 = CodeBlock(phonetic=watch_23) { phonetic[2..3]; }
watch_24 = Watch(code_block_37)
code_block_38 = CodeBlock { 2; }
getItemAtIndex = List.GetItemAtIndex(list=watch_21, index=code_block_38)
watch_25 = Watch(getItemAtIndex)

# group: リストとアクセス リスト項目を結合
# 説明<グループの説明を編集するにはここをダブル クリック>
# note: ネストされたリストを作成し、ネストされたリストから項目を取得します。
code_block_39 = CodeBlock()
# ---------- code_block_39.designscript (6 lines) ----------
kitchen = ["table","stove","sink","refrigerator"];
livingRoom = ["sofa","books"];
bedroom = ["bed","dirty clothes"];
bathroom = ["tooth brush"];
//
allMyStuff = [kitchen, livingRoom, bedroom, bathroom];
# ----------------------------------------
watch_26 = Watch(code_block_39.allMyStuff)
# note: 3 番目のリスト内の 2 番目の項目にアクセスします(つまり、インデックス '2' のリスト内のインデックス '1' の項目にアクセスします)。
code_block_40 = CodeBlock(list=watch_26) { list[2][1]; }
watch_27 = Watch(code_block_40)

# group: 複製
# note: 複製ガイドを使用すると、「外積」としてリストをレーシングするよう指定できます。
code_block_41 = CodeBlock { x_vals = 0..10; y_vals = -30..-40; }
code_block_42 = CodeBlock(x_vals=code_block_41.x_vals, y_vals=code_block_41.y_vals) { Point.ByCoordinates(x_vals, y_vals); }
code_block_43 = CodeBlock { x_vals = 0..10; y_vals = -15..-25; }
code_block_44 = CodeBlock(x_vals=code_block_43.x_vals, y_vals=code_block_43.y_vals) { Point.ByCoordinates(x_vals<1>, y_vals<2>); }
byCoordinates_4 = Point.ByCoordinates(x=code_block_41.x_vals, y=code_block_41.y_vals)
byCoordinates_5 = Point.ByCoordinates(x=code_block_43.x_vals, y=code_block_43.y_vals, lacing=CrossProduct)
# note: 複製ガイドは、角括弧を使用して 2 つまたは 3 つの 1 次元集合を取得し、それぞれの要素をまとめて 1、2、3 次元のコレクションを生成します。
# note: この例では、2 つの x 値と 5 つの y 値があります。複製ガイドでは、作成する組み合わせを 5 つの点の 2 つのリストまたは 2 つの点の 5 つのリストとして指定できます。
code_block_45 = CodeBlock()
# ---------- code_block_45.designscript (5 lines) ----------
x_vals = 0..1;
y_vals = -3..-7;
//
Point.ByCoordinates(x_vals<1>, y_vals<2>);
Point.ByCoordinates(x_vals<2>, y_vals<1>);
# ----------------------------------------
watch_28 = Watch(code_block_45.out2)
watch_29 = Watch(code_block_45.out3)

# group: ブール演算
# 専用ノードを Code Block ノードと比較します。
# note: ブール演算の切り替えノード
boolean = BoolSelector(true)
watch_30 = Watch(boolean)
# note: 同じ結果を得るには、Code Block で「true」または「false」の値を使用します。
code_block_46 = CodeBlock { true; }
watch_31 = Watch(code_block_46)
