# Dynamo graph Core_ListAtLevel.dyn (Dynamo 3.1.0.3411)
# author: Dynamo Team
# List@Level と、それを使用して List.Map ノードと同じ結果を得る方法について説明します。List@Level が実際にどのように機能するかを示すために、一連のパネルを作成します。

# group: 情報
# note: 操作するリストのレベルを決定するには、プレビュー バブルまたは watch ノードの下部を見て、List@Level 表記から上に行を追います。

# group: 情報
# List@Level の使用に関する一般情報
# note: LIST@LEVEL
# 作業するリストのレベルを直接選択できるようにすることによって、List.Map の機能を List@Level  に置き換えます。
# note: 作業中のリスト レベルを変更するには、リスト入力ポートの横にある矢印をクリックし、[レベルを使用]オプションを有効にします。
# 入力ポートで List@Level  が最初に有効になったときに、2 番目に内側のレベル(L2)のリストが選択されて処理されます。

# group: 情報
# このグラフの動作
# note: グリッドの内部にパネルを作成したいと思います。これを行うには、最も内側のレベルの各リストのインデックス 1 と 2 の点を取得する必要があります。これは、List@Level 機能を使用して簡単に行うことができます。リストのグループ化は、[リスト構造を保持]オプションを有効にすることによって保持されます。しかし、使用するリストのレベルを決定するために、まず Point.ByCoordinates で作成したリストをもう少し調べてみましょう。

# group: 入力
# 説明<グループの説明を編集するにはここをダブル クリック>
code_block = CodeBlock { 0..30..#8; 12..0..#4; }
# note: この例では、一連の点を含む 3D リストを作成します。L3 には 8 つのリストがあり、各リストには他の 4 つのリスト(L2)が含まれます。4 つのリストのそれぞれに 4 つの点(L1)が含まれ、点の数は合計 128 個になります。
byCoordinates = Point.ByCoordinates(x=code_block.out0, y=code_block.out1, z=code_block.out1, lacing=CrossProduct)

# group: List.Map を List@Level に置き換える
code_block_2 = CodeBlock { [1,2]; }
# note: Dynamo の旧バージョンでは、List.Map を使用してリストの内部レベルを取得していました。List.Map を使用して同じ結果が得られても、ワークスペースにはより多くのノードが導入されます。ここでは List@Level を使用してグリッドの内部の点をより効率的に取得します。これらの点を使用してパネルを作成します。
# また、[リスト構造を保持]オプションを利用して、初期リストのグループ化を維持するとともに、平坦化を防止します。[リスト構造を保持]を無効にすると、8 つではなく 1 つの NURBS サーフェスが作成されます。
getItemAtIndex = List.GetItemAtIndex(list=byCoordinates@@L2, index=code_block_2)
code_block_3 = CodeBlock { [1,2]; }
# note: リストは各種レベルに存在し、L1 が最も低いレベルです。このノードによって生成される要素の総数は、右下に示すように 64 です。
getItemAtIndex_2 = List.GetItemAtIndex(index=code_block_3)  # unwired: list
# note: 以下は、追加のノードが必要な List@Level の適用に相当する List.Map です
map = List.Map(f_x=getItemAtIndex_2)  # unwired: list
map_2 = List.Map(list=byCoordinates, f_x=map)

# group: ジオメトリを作成する
# note: 選択した点のセットを使用して、パネルを作成できるようになりました。
byPoints = NurbsSurface.ByPoints(points=getItemAtIndex)
byBestFitThroughPoints = Line.ByBestFitThroughPoints(bestFitPoints=getItemAtIndex)

# group: List@Level と Count でリストを検査する
# note: List.Count ノードは、各リストに存在する要素の数を返します。選択したレベルに応じて、異なる値が返されます。L3 の横の矢印をクリックして値を変更してみてください。
# note: L3 には 8 つのリストがあり、それぞれに 4 つのリストが含まれています。したがって、L3 を選択すると List.Count 関数が 8 つのリストに実装され、8 つの値 '4' を与えます。
count = List.Count(list=byCoordinates@L3)

# group: "リスト構造を保持" を使用する
# note: このノードは、L2 の各リストに存在する要素の数を返します。既定では、結果は 1次元リストに平坦化されます。
count_2 = List.Count(list=byCoordinates@L2)
# note: リストのネスト構造を保持するには、オプション[リスト構造を保持]を選択します。"@@" は Designscript でリスト構造を保持する方法を示します。
count_3 = List.Count(list=byCoordinates@@L2)

# group: List@Level と Flatten でリストを検査する
# note: 追加の例として、List@Level 機能を Flatten ノードと一緒に使用することによって、リストの内部レベルでネストされた構造を簡単に平坦化することができます。List@Level スピナーの横にある矢印をクリックして、平坦化されるレベルを変更してみてください。
# note: L3 を選択すると、そのレベルの 8 つのリストが 1 次元配列に変換されます。8 つのリストのそれぞれが 4 つの項目(リストでもある)を含んでいるため、L3 のすべてのリストが平坦化され、16 個の点の  8 つのリストが生成されます。
flatten = List.Flatten(list=byCoordinates@L3)
