# Dynamo graph Core_ListLacing.dyn (Dynamo 3.1.0.3411)
# author: Dynamo Team
# リスト レーシング - リスト レーシングのすべてのモードがこのグラフで検討され、実証されます。

# group: 情報
# note: リストのレーシング
# レーシングは Dynamo ノードが異なるリストの項目をまとめて一致させるのに使用するロジックです。Dynamo のほとんどのノードで、「レーシング動作」を設定することで、情報のリストの組み合わせ方法を選択できます。
# 次の例には、Line.ByStartPointEndPoint ノードに渡される点の 2 つのリストがあります。線分を作成するノードは、どの点のセットの間に何本の線を描画するかを決定する必要があります。
# レーシング動作を設定するには、2 つ以上の入力ポートを持つノードを右クリックし、[レーシング]を選択します。

# group: ヒント
# note: ヒント: ジオメトリを作成するノードの背景プレビューに、項目のインデックスをラベルとして示します。右クリックして[ラベルを表示]を選択します。

# group: ヒント
# note: ヒント: ノードのレーシング動作は、ノードの右下の小さな記号によって表されます。記号が表示されていない場合は、ノードにレーシングが設定されていません。

# group: 入力
# note: 長いシリーズ(10 要素)
code_block = CodeBlock { 0..9; }
code_block_2 = CodeBlock { 4; }
# note: 短いシリーズ(6 要素)
code_block_3 = CodeBlock { 0..5; }
code_block_4 = CodeBlock { 0..9; }
code_block_5 = CodeBlock { -10; 4; }
code_block_6 = CodeBlock { 0..5; }
code_block_7 = CodeBlock { 0..9; }
code_block_8 = CodeBlock { 10; 4; }
code_block_9 = CodeBlock { 0..5; }

# group: 点群を作成
# Line.ByStartPointEndPoint の入力として使用する 2 つの点群のセット(10 x 6)を作成します。
byCoordinates = Point.ByCoordinates(x=code_block, z=code_block_2)
byCoordinates_2 = Point.ByCoordinates(x=code_block_3)

# group: 最長レーシング
# note: 最長レーシング
# 最も長い入力リストの項目の数だけ、線分を描画します。短いリストで点が不足すると、最長のリストの最後の項目に合わせて、最後の項目のコピーを作成します。
byStartPointEndPoint = Line.ByStartPointEndPoint(startPoint=byCoordinates, endPoint=byCoordinates_2, lacing=Longest)

# group: 点群を作成
# Line.ByStartPointEndPoint の入力として使用する 2 つの点群のセット(10 x 6)を作成します。
byCoordinates_3 = Point.ByCoordinates(x=code_block_4, y=code_block_5.out0, z=code_block_5.out1)
byCoordinates_4 = Point.ByCoordinates(x=code_block_6, y=code_block_5.out0)

# group: 最短レーシング
# note: 最短レーシング
# 最も短い入力リストの項目の数だけ、線分を描画します。長いリストに「残った」点は無視されます。
byStartPointEndPoint_2 = Line.ByStartPointEndPoint(startPoint=byCoordinates_3, endPoint=byCoordinates_4)

# group: 点群を作成
# Line.ByStartPointEndPoint の入力として使用する 2 つの点群のセット(10 x 6)を作成します。
byCoordinates_5 = Point.ByCoordinates(x=code_block_7, y=code_block_8.out0, z=code_block_8.out1)
byCoordinates_6 = Point.ByCoordinates(x=code_block_9, y=code_block_8.out0)

# group: 外積レーシング
# note: 外積レーシング
# 可能なすべてのペアリングの組み合わせを作成します。長いリストが 10 点で短いリストが 6 点の場合、10 x 6 = 60 行となります。
byStartPointEndPoint_3 = Line.ByStartPointEndPoint(startPoint=byCoordinates_5, endPoint=byCoordinates_6, lacing=CrossProduct)
# note: 作成された散文はネストされたリストに格納され、最初に指定したリストに応じて、10 行からなる 6 つのリストか 6 行からなる 10 のリストのいずれかになります。
watch = Watch(byStartPointEndPoint_3)
