# Dynamo graph Core_Math.dyn (Dynamo 3.4.1.7055)
# author: Dynamo Team
# ここでは、Dynamo のさまざまな数学関数と機能について詳しく説明します。

# group: 情報
# note: MATH
# Dynamo の Math は、Math ライブラリおよび Operators ライブラリのノード、または Code Block ノードを使用して実行できます。以下に、これら 3 つのメソッドのそれぞれを使用して、基本的な数学演算を実行する方法を説明します。

# group: 基本的な算術演算子
# note: 次のような算術演算子
# +、-、*、/、%

# group: 基本的な論理演算子
# note: 比較演算子は次のとおりです
# <、>、<=、>=、!=、==

# group: ブール演算子
# note: ブール演算子
# (他の演算子はライブラリ内にあります。)

# group: 丸め
# note: 丸め

# group: 複雑な数学関数
# ノード、Python、Fo を使用して同じ最終結果を得る 4 つの例
# note: This example shows four different ways to approach dealing with Math functions.  Each of these examples starts with a grid of points, calculates z-coordinates for the points and then makes a surface.  Only the calculation method differs; these methods all solve the same.
# 1. Nodes. Math nodes are in the Math section of the Library which is further split into Functions, Logic and Operators.
# 2. Python.
# 3. Code Block Node.  Double-click anywhere in the canvas to create a code block node.  Syntax for each function matches the name of the node in Dynamo.
# ** Note: You can adjust the resolution of the geometry preview by navigating to the Render Precision settings: Dynamo -> Preferences -> Visual Settings -> Render Precision
# note: この例についての詳細:
# http://dynamobim.org/math-transit/

# group: 円弧
# note: 2 つの異なるメソッドで円弧を作成します(ノードを使用する方法と Code Blocks を使用する方法)。結果は分かりやすくするために視覚化されています。

# group: ヒント
# ジオメトリ ノードをハイライト表示します
# note: ヒント: ジオメトリを描画するノードを選択すると、作成されるジオメトリの色がシアンに変わります。このコード ブロックは、グラフの軸、曲線に沿った点、曲線自体の順番に描画します。曲線が描画される背景を表示するには、コード ブロックを選択します。

# group: 余弦曲線
# note: この一連の例では、ノードと Code Block を使用して余弦関数をグラフ化する方法について説明します。
# 各例では、一連の点群の x 値として一連の数値を取り、x 値から y 値を計算し、余弦曲線の形状に線分を描画します。各グラフの最後にある大きな Code Block は、描画されたジオメトリを画面の別の部分に移動して、すべてが重ならないようにします。

# group: ヒント
# レンダー精度
# note: Tip: Adjust how precisely the geometry in the background preview is rendered by navigating to Dynamo -> Preferences -> Visual Settings -> Render Precision.  A higher value will make curved surfaces look smoother, but it will take more processing power to draw.

# group: ノード > 点群のリストの初期入力
code_block = CodeBlock { -10..10..#20; }

# group: ノード > 最初の点のリストの作成と操作
# note: 点の通芯を作成します。
# レーシング動作は「外積」と
# なることに注意してください。
byCoordinates = Point.ByCoordinates(x=code_block, y=code_block, lacing=CrossProduct)
flatten = List.Flatten(list=byCoordinates)
X = Point.X(point=flatten)
Y = Point.Y(point=flatten)

# group: ノード > 振幅
# note: 振幅
number_slider = DoubleSlider(5.51, range=0..10 step 0.1)  # graph input

# group: ノード > 四角
number = DoubleInput(2)  # graph input
pow = Math.Pow(number=X, power=number)

# group: ノード > 四角
number_2 = DoubleInput(2)  # graph input
pow_2 = Math.Pow(number=Y, power=number_2)

# group: ノード > 周波数
# note: 周波数
number_slider_2 = DoubleSlider(1.724, range=0..6 step 0.1)  # graph input

# group: ノード > 四角
number_3 = DoubleInput(2)  # graph input
pow_3 = Math.Pow(number=number_slider_2, power=number_3)

# group: ノード > 一連の数学的計算と操作により、ノードを使用して 'ripple' ジオメトリを作成します
add = pow + pow_2
add_2 = add + pow_3
sqrt = Math.Sqrt(number=add_2)
# note: Dynamo の角度は Degree 単位です
radiansToDegrees = Math.RadiansToDegrees(radians=sqrt)
sin = Math.Sin(angle=radiansToDegrees)
div = sin / sqrt
mul = number_slider * div

# group: ノード > 結果の点群を収集し、最終レンダリングの準備を行います
byCoordinates_2 = Point.ByCoordinates(x=X, y=Y, z=mul)
# note: 点群の最初のコレクション(20x20)から点群のグループ数をカウントします。
count = List.Count(list=byCoordinates)

# group: ノード > 点群のコレクション
# note: フラット リストを行ごとの一連の
# リストに分割します
chop = List.Chop(list=byCoordinates_2, lengths=count)

# group: ノード > 曲線ネットワーク
# note: 点を通過する NURBS 曲線
# を作成します
byPoints = NurbsCurve.ByPoints(points=chop)

# group: ノード > 最終サーフェス
# note: サーフェスを作成します
byLoft = Surface.ByLoft(crossSections=byPoints)

# group: Code Block > 点群のリストの初期入力
code_block_2 = CodeBlock { -10..10..#20; }

# group: Code Block > 最初の点のリストの作成と操作
byCoordinates_3 = Point.ByCoordinates(x=code_block_2, y=code_block_2, lacing=CrossProduct)
flatten_2 = List.Flatten(list=byCoordinates_3)
Y_2 = Point.Y(point=flatten_2)
X_2 = Point.X(point=flatten_2)

# group: Code Block > ジオメトリを移動するためのヘルパー関数
# note: ジオメトリを移動します
code_block_3 = CodeBlock(x=Y_2) { x+60; }

# group: Code Block > 周波数
number_slider_3 = DoubleSlider(1.724, range=0..5 step 0.1)  # graph input

# group: Code Block > 振幅
number_slider_4 = DoubleSlider(5.51, range=0..10 step 0.1)  # graph input

# group: Code Block > Python を使用して 'ripple' ジオメトリを作成するための、一連の数学的計算と操作
# note: 計算メソッドの名前。最初の例で使用する Dynamo ノードの名前と一致します。
code_block_4 = CodeBlock(x=X_2, y=Y_2, c=number_slider_3, A=number_slider_4)
# ---------- code_block_4.designscript (6 lines) ----------
sum = Math.Pow(x,2) + Math.Pow(y,2) + Math.Pow(c,2);

num1 = Math.Sqrt(sum);
num2 = Math.Sin( Math.RadiansToDegrees(num1) );

A * num2 / num1;
# ----------------------------------------

# group: Code Block > 結果の点群を収集し、最終レンダリングの準備を行います
byCoordinates_4 = Point.ByCoordinates(x=code_block_3, y=X_2, z=code_block_4.out3)
count_2 = List.Count(list=byCoordinates_3)

# group: Code Block > 点群のコレクション
chop_2 = List.Chop(list=byCoordinates_4, lengths=count_2)

# group: Code Block > 曲線ネットワーク
byPoints_2 = NurbsCurve.ByPoints(points=chop_2)

# group: Code Block > 最終サーフェス
byLoft_2 = Surface.ByLoft(crossSections=byPoints_2)

# group: Python > 点群のリストの初期入力
code_block_5 = CodeBlock { -10..10..#20; }

# group: Python > 最初の点のリストの作成と操作
byCoordinates_5 = Point.ByCoordinates(x=code_block_5, y=code_block_5, lacing=CrossProduct)
flatten_3 = List.Flatten(list=byCoordinates_5)
X_3 = Point.X(point=flatten_3)
Y_3 = Point.Y(point=flatten_3)

# group: Python > ジオメトリを移動するためのヘルパー関数
# note: ジオメトリを移動します
code_block_6 = CodeBlock(x=X_3) { x+30; }

# group: Python > 振幅
number_slider_5 = DoubleSlider(5.51, range=0..10 step 0.1)  # graph input

# group: Python > 周波数
number_slider_6 = DoubleSlider(1.724, range=0..5 step 0.1)  # graph input

# group: Python > Python を使用して 'ripple' ジオメトリを作成するための、一連の数学的計算と操作
python_script = Python(Amplitude=number_slider_5, X=X_3, Y=Y_3, Frequency=number_slider_6)  # CPython3
# ---------- python_script.python (27 lines) ----------
import clr
clr.AddReference('ProtoGeometry')
from Autodesk.DesignScript.Geometry import *

import math

# The inputs to this node will be stored as a list in the IN variable.
amp = IN[0]   # single value
x = IN[1]     # list
y = IN[2]     # list (expect same length as x)
c = IN[3]     # single value

# Declare an empty array of z-values
z = []

# Solve the equation for each x and y value
for index in range(len(x)):
	sum = math.pow(x[index],2) + math.pow(y[index],2) + math.pow(c,2)
	num1 = math.sqrt(sum)
	num2 = math.sin(num1)
	zVal = amp * num2 / num1
	
	# Append the answer to the list of z values
	z.append(zVal)

# Assign the z-values to the OUT variable
OUT = z
# ----------------------------------------

# group: Python > 結果の点群を収集し、最終レンダリングの準備を行います
byCoordinates_6 = Point.ByCoordinates(x=code_block_6, y=Y_3, z=python_script)
count_3 = List.Count(list=byCoordinates_5)

# group: Python > 点群のコレクション
chop_3 = List.Chop(list=byCoordinates_6, lengths=count_3)

# group: Python > 曲線ネットワーク
byPoints_3 = NurbsCurve.ByPoints(points=chop_3)

# group: Python > 最終サーフェス
byLoft_3 = Surface.ByLoft(crossSections=byPoints_3)

# group: Code Block を使用した余弦曲線 > 入力
# note: 基準座標点
code_block_7 = CodeBlock { 25; 20; }
# note: 一連の X 値
code_block_8 = CodeBlock { 0..10..#20; }
# note: 振幅
number_slider_7 = DoubleSlider(3, range=0..10 step 0.1)  # graph input
# note: 周波数
number_slider_8 = DoubleSlider(36, range=0..100 step 0.1)  # graph input

# group: Code Block を使用した余弦曲線 > Cos 曲線関数
# 指定された周波数の余弦値を取得し、角度に振幅を掛けます。
code_block_9 = CodeBlock(amplitude=number_slider_7, frequency=number_slider_8, angle=code_block_8) { amplitude * Math.Cos(frequency * angle); }

# group: Code Block を使用した余弦曲線 > 中間演算子
byCoordinates_7 = Point.ByCoordinates(x=code_block_7.out0, y=code_block_7.out1)
byCoordinates_8 = Point.ByCoordinates(x=code_block_8, y=code_block_9)

# group: Code Block を使用した余弦曲線 > 余弦曲線を作成および視覚化します
code_block_10 = CodeBlock(base=byCoordinates_7, pts=byCoordinates_8)
# ---------- code_block_10.designscript (14 lines) ----------
// Make axes from base point
dimension = 10;
top = Point.ByCoordinates(base.X, base.Y + dimension/2);
bottom = Point.ByCoordinates(base.X, base.Y - dimension/2);
right = Point.ByCoordinates(base.X + 10, base.Y);
Line.ByStartPointEndPoint(bottom, top);
Line.ByStartPointEndPoint(base, right);

// Move function results to base point
vec = base.AsVector();
newPts = pts.Add(vec);

// Draw a line through the points
NurbsCurve.ByPoints(newPts);
# ----------------------------------------

# group: ノードを使用した余弦曲線 > 入力
# note: 基準点 x、y 座標
code_block_11 = CodeBlock { -5; 20; }
# note: 一連の X 値
code_block_12 = CodeBlock { 0..10..#20; }
# note: 周波数
number_slider_9 = DoubleSlider(36, range=0..100 step 0.1)  # graph input

# group: ノードを使用した余弦曲線 > 振幅をコントロールします
# note: 振幅
number_slider_10 = DoubleSlider(3, range=0..10 step 0.1)  # graph input

# group: ノードを使用した余弦曲線
mul_2 = number_slider_9 * code_block_12

# group: ノードを使用した余弦曲線 > Math.Cos 関数
# 各初期番号の余弦値を取得します。
cos = Math.Cos(angle=mul_2)

# group (continued): ノードを使用した余弦曲線
mul_3 = number_slider_10 * cos

# group: ノードを使用した余弦曲線 > 中間演算子
byCoordinates_9 = Point.ByCoordinates(x=code_block_11.out0, y=code_block_11.out1)
# note: ヒント: ジオメトリを作成するすべてのノードで、プレビュー機能のオン/オフを切り替えられます。右クリックして[プレビュー]をオンまたはオフにします。
byCoordinates_10 = Point.ByCoordinates(x=code_block_12, y=mul_3)

# group: ノードを使用した余弦曲線 > 余弦曲線を作成および視覚化します
code_block_13 = CodeBlock(base=byCoordinates_9, pts=byCoordinates_10)  # same code as code_block_10

# group: ノードを使用した円弧 > 入力
# 必要な入力を作成します。
# 1. 中心点
# 2. 半径
# 3. 開始角度
# 4. 終了角度
# 5. 法線(ZAxsis)
code_block_14 = CodeBlock { 0; 35; }
byCoordinates_11 = Point.ByCoordinates(x=code_block_14.out0, y=code_block_14.out1)
code_block_15 = CodeBlock { 5; 0; }
# note: 弧長を変更するには、スライダを移動します。
number_slider_11 = DoubleSlider(247.821, range=0..360 step 0.1)  # graph input
ZAxis = Vector.ZAxis()

# group: ノードを使用した円弧 > 中心点、半径、角度で円弧を作成します
# note: ノードや Code Block の角度はラジアン単位です。
byCenterPointRadiusAngle = Arc.ByCenterPointRadiusAngle(center=byCoordinates_11, radius=code_block_15.out0, startAngle=code_block_15.out1, endAngle=number_slider_11, normal=ZAxis)

# group: ノードを使用した円弧 > 出力を視覚化
endPoint = Curve.EndPoint(curve=byCenterPointRadiusAngle)
byStartPointEndPoint = Line.ByStartPointEndPoint(startPoint=endPoint, endPoint=byCoordinates_11)
startPoint = Curve.StartPoint(curve=byCenterPointRadiusAngle)
byStartPointEndPoint_2 = Line.ByStartPointEndPoint(startPoint=startPoint, endPoint=byCoordinates_11)

# group: ノードを使用した操作 > -
code_block_16 = CodeBlock { 5; 2; }
sub = code_block_16.out0 - code_block_16.out1
watch = Watch(sub)

# group: Code Block を使用した操作 > -
code_block_17 = CodeBlock { 5-2; }
watch_2 = Watch(code_block_17)

# group: Code Block を使用した操作 > %
code_block_18 = CodeBlock { 5%2; }
watch_3 = Watch(code_block_18)

# group: ノードを使用した操作 > %
code_block_19 = CodeBlock { 5; 2; }
mod = code_block_19.out0 % code_block_19.out1
watch_4 = Watch(mod)

# group: Code Block を使用した操作 > <=
code_block_20 = CodeBlock { 5<=2; }
watch_5 = Watch(code_block_20)

# group: Code Block を使用した操作 > >
code_block_21 = CodeBlock { 5>2; }
watch_6 = Watch(code_block_21)

# group: ノードを使用した操作 > <=
code_block_22 = CodeBlock { 5; 2; }
le = code_block_22.out0 <= code_block_22.out1
watch_7 = Watch(le)

# group: ノードを使用した操作 > >
code_block_23 = CodeBlock { 5; 2; }
gt = code_block_23.out0 > code_block_23.out1
watch_8 = Watch(gt)

# group: Code Blocks を使用した円弧 > 入力
# 必要な入力を作成します。
# 1. 中心点
# 2. 終了角度
code_block_24 = CodeBlock { 15; 35; }
byCoordinates_12 = Point.ByCoordinates(x=code_block_24.out0, y=code_block_24.out1)
number_slider_12 = DoubleSlider(126.947, range=0..360 step 0.1)  # graph input

# group: Code Blocks を使用した円弧 > 中心点、半径、角度で円弧を作成します
code_block_25 = CodeBlock(center=byCoordinates_12, endAngle=number_slider_12) { Arc.ByCenterPointRadiusAngle(center,5,0,endAngle,Vector.ZAxis()); }

# group: Code Blocks を使用した円弧 > 出力を視覚化
startPoint_2 = Curve.StartPoint(curve=code_block_25)
byStartPointEndPoint_3 = Line.ByStartPointEndPoint(startPoint=startPoint_2, endPoint=byCoordinates_12)
endPoint_2 = Curve.EndPoint(curve=code_block_25)
byStartPointEndPoint_4 = Line.ByStartPointEndPoint(startPoint=endPoint_2, endPoint=byCoordinates_12)

# group: ノードを使用して丸める > 入力
code_block_26 = CodeBlock { 3.14159; }
code_block_27 = CodeBlock { 3; }

# group: ノードを使用して丸める > 切り下げ
floor = Math.Floor(number=code_block_26)
watch_9 = Watch(floor)

# group: ノードを使用して丸める > 切り上げ
ceiling = Math.Ceiling(number=code_block_26)
watch_10 = Watch(ceiling)

# group: ノードを使用して丸める > 切り上げまたは切り捨て
# 最も近い値
round = Math.Round(number=code_block_26)
watch_11 = Watch(round)

# group: ノードを使用して丸める > 指定した桁数に丸める
round_2 = Math.Round(number=code_block_26, digits=code_block_27)
watch_12 = Watch(round_2)

# group: Code Block を使用して丸める > 入力
code_block_28 = CodeBlock { 3.14159; }

# group: Code Block を使用して丸める > 切り下げ
code_block_29 = CodeBlock(num=code_block_28) { Math.Floor(num); }
watch_13 = Watch(code_block_29)

# group: Code Block を使用して丸める > 切り上げ
code_block_30 = CodeBlock(num=code_block_28) { Math.Ceiling(num); }
watch_14 = Watch(code_block_30)

# group: Code Block を使用して丸める > 切り上げまたは切り捨て
# 最も近い値
code_block_31 = CodeBlock(num=code_block_28) { Math.Round(num); }
watch_15 = Watch(code_block_31)

# group: Code Block を使用して丸める > 指定した桁数に丸める
# 説明<グループの説明を編集するにはここをダブル クリック>
code_block_32 = CodeBlock(num=code_block_28) { Math.Round(num,3); }
watch_16 = Watch(code_block_32)

# group: Code Block を使用した操作 > ==(等しい)
code_block_33 = CodeBlock { true == false; }
watch_17 = Watch(code_block_33)

# group: Code Block を使用した操作 > Not
code_block_34 = CodeBlock { !true; }
watch_18 = Watch(code_block_34)

# group: Code Block を使用した操作 > && (および)
code_block_35 = CodeBlock { true && false; }
watch_19 = Watch(code_block_35)

# group: Code Block を使用した操作 > || (または)
code_block_36 = CodeBlock { true || false; }
watch_20 = Watch(code_block_36)

# group: ノードを使用した操作 > ==(等しい)
boolean = BoolSelector(true)  # graph input
boolean_2 = BoolSelector(false)  # graph input
eq = boolean == boolean_2
watch_21 = Watch(eq)

# group: ノードを使用した操作 > || (または)
boolean_3 = BoolSelector(true)  # graph input
boolean_4 = BoolSelector(false)  # graph input
or_ = boolean_3 || boolean_4
watch_22 = Watch(or_)

# group: ノードを使用した操作 > && (および)
boolean_5 = BoolSelector(true)  # graph input
boolean_6 = BoolSelector(false)  # graph input
and_ = boolean_5 && boolean_6
watch_23 = Watch(and_)

# group: ノードを使用した操作 > Not
boolean_7 = BoolSelector(true)  # graph input
not_ = Not(x=boolean_7)
watch_24 = Watch(not_)
