# Dynamo graph Core_PassingFunctions.dyn (Dynamo 3.1.0.3411)
# author: Dynamo Team
# Dynamo で関数を渡す方法を説明します

# group: 情報
# note: 関数を渡す
# Dynamo は関数言語です。つまり、アクションをオブジェクトと同じように取り扱います。Dynamo のほとんどのノードは関数に変換でき、一連のデータに対して非常に精度が高い方法で使用することができます。
# 関数の作成方法や関数を渡す方法は、「Run for 20 minutes! (ランニング 20 分!)」のような命令を話すのに似ていますが、話す相手は後で指定します。
# この例では、円の通芯が複雑な構造で表されています。一連の円を選択するコマンドを直接使用し、次に下位レベルのデータにコマンドを関数として渡すことで、異なる結果を得ています。

# group: 初期入力
# 5x8 の点群の行列を作成します
code_block = CodeBlock { 0..#8..4; }
code_block_2 = CodeBlock { 0..#5..4; }
byCoordinates = Point.ByCoordinates(x=code_block, y=code_block_2, lacing=CrossProduct)

# group: 円の行列を描画します
# note: 点のこのリストは階層構造で整理されています。つまり、リストのリストになっています。グリッドは X 方向に 8 つの点、Y 方向に 5 つの点で構成されています。このリストは 5 つの項目の 8 つのリスト、つまり点の列のリストを表します。
watch = Watch(byCoordinates)
code_block_3 = CodeBlock { 1.5; }
# note: 各点の周囲に円を描画します。
byCenterPointRadius = Circle.ByCenterPointRadius(centerPoint=watch, radius=code_block_3)

# group: 2 番目と 3 番目のリストを選択します
# 関数を渡します
code_block_4 = CodeBlock { 1..2; }
# note: 円のネストされたリストから項目{1,2}が選択されます。Dynamo ノードは常にリストの「外側から内側へ」つまり最も高いレベルから最も低いレベルに操作します。
# リストから項目 1 と 2 を選択すると、元のネストされたリスト構造からリスト #1 とリスト #2が返されます。
getItemAtIndex = List.GetItemAtIndex(list=byCenterPointRadius, index=code_block_4)

# group: 上へ押し出し
# 作成される円柱
# note: マッピングによって選択する前と同じように、選択したデータが同一の構造内に引き続き存在しています。
watch_2 = Watch(getItemAtIndex)
code_block_5 = CodeBlock { 3; }
# note: 円のこのリストは上に押し出されます。
extrude = Curve.Extrude(curve=watch_2, distance=code_block_5)

# group: 各リストから 2 番目と 3 番目の項目を選択します
# 関数を渡します
code_block_6 = CodeBlock { 1..2; }
# note: List@Level 機能では、List.GetItemAtIndex ノードの入力ポートで L2 を選択することにより、ノードの出力から最初の 2 つのリストを取得するのではなく、各リストから 1 番目と 2 番目の項目を取得することができます。
# この機能は、旧バージョンの Dynamo で、入力したリストの内側のレベルにアクセスするために使用されていた List.Map メソッドの機能を細分化したものです。
getItemAtIndex_2 = List.GetItemAtIndex(list=byCenterPointRadius@L2, index=code_block_6)

# group: 下へ押し出し
# 作成される円柱
watch_3 = Watch(getItemAtIndex_2)
code_block_7 = CodeBlock { -3; }
# note: 円のこのリストは下に押し出されます。
extrude_2 = Curve.Extrude(curve=watch_3, distance=code_block_7)
