# Dynamo graph Core_Python.dyn (Dynamo 4.1.0.2940)
# author: Dynamo Team
# Dynamo 内の Python ノードを使用します

# group: 情報
# note: Python
# Dynamo では、2 つある Python ノードのいずれかで CPython を使用できます(ここに表示されていない 2 番目のタイプの Python ノードでは、実行するスクリプトを外部ファイルから読み込むことができます)。
# ノードに含まれるスクリプトを表示するには、Python ノードをダブルクリックします。
# 入力は IN 配列に含まれます。出力は OUT 変数に割り当てる必要があります。出力は単一の値にしたり、配列自身に設定することもできます。

# group: Python ノードを使用してリストにサイン操作を適用します
# note: この例では、リストのすべての項目を追加したり、取り去ったりします。入力は数値と数値のリストです。数値の記号で追加と除去のいずれであるかが決まります。

# group: 正の数値、0、負の数値を選択します
# 説明<グループの説明を編集するにはここをダブル クリック>
# note: 操作の記号を選択します
#     数 < 0      それぞれを減算
#     数 ＝ 0      0
#     数 > 0      それぞれを追加
integer_slider = IntegerSlider(1, range=-1..2 step 1)

# group: 入力リストを作成します
# note: リストを作成
code_block = CodeBlock { 0..10; }
watch = Watch(code_block)

# group: Python
# サイン操作を適用します
# note: 外部からの出力は配列となり、最初の項目が単一の値、2 番目の項目が値のリストになります。このデータ構造は、Python 設定自体で指定されているものです。配列を指定することで、Dynamo グラフに任意の数の出力を送信できます。
python_script = Python(Sign=integer_slider, List=watch)  # PythonNet3
# ---------- python_script.python (31 lines) ----------
# Python script to find add or subtract a series of numbers. 

# Boiler-plate import statments included out-of-the-box
import clr
clr.AddReference('ProtoGeometry')
from Autodesk.DesignScript.Geometry import *

# The inputs to this node will be stored as a list in the IN variable.
sign = IN[0]  # -1 for subtract all, 0 for do nothing, 1 for add all
nums = IN[1]  # List of numbers to subtract or add

partials = [] # Empty array to contain partial sums or differences
result = 0    # Initialize the sum or difference to 0

# Loop through each item and add it or subtract it from the result.
for index in range(len(nums)):
	if sign > 0:
		result = result + nums[index]
		partials.append(result)
	elif sign == 0:
		partials.append(result)
		continue
	else:
		result = result - nums[index]
		partials.append(result)

# Assign the output to the OUT variable
#OUT = results  # Use this to output only the result.
OUT = []
OUT.append(result)
OUT.append(partials)
# ----------------------------------------

# group: 結果リスト
code_block_2 = CodeBlock { 1; }
getItemAtIndex = List.GetItemAtIndex(list=python_script, index=code_block_2)
# note: 一連の部分的な結果。
watch_2 = Watch(getItemAtIndex)

# group: 結果の合計
code_block_3 = CodeBlock { 0; }
getItemAtIndex_2 = List.GetItemAtIndex(list=python_script, index=code_block_3)
# note: 全体の結果。
watch_3 = Watch(getItemAtIndex_2)

# group: Python ジオメトリの作成
# note: この Python の例には入力はありません。Dynamo の protogeometry ライブラリを使用してジオメトリを作成する方法を説明します。Python ノードでは表示可能なジオメトリが作成されるため、他のノードと同様に、ジオメトリを選択するとジオメトリがハイライト表示されます。
python_script_2 = Python()  # PythonNet3
# ---------- python_script_2.python (24 lines) ----------
import clr
clr.AddReference('ProtoGeometry')
from Autodesk.DesignScript.Geometry import *
#The inputs to this node will be stored as a list in the IN variable.
dataEnteringNode = IN

p1 = Point.ByCoordinates(0, 0, 0);
p2 = Point.ByCoordinates(-10, -10, -10);

l = Line.ByStartPointEndPoint(p1, p2);

pts = [
	Point.ByCoordinates(0, 0, 0),
	Point.ByCoordinates(10, 10, 0),
	Point.ByCoordinates(20, 0, 0),
	Point.ByCoordinates(30, 10, 0),
	Point.ByCoordinates(40, 0, 0) ]
	
spline = NurbsCurve.ByPoints(pts)

surf = spline.Extrude(Vector.ByCoordinates(0, 0, 1), 10)

#Assign your output to the OUT variable
OUT = [l, spline, surf]
# ----------------------------------------

# group: 結果出力を確認します
# note: ヒント: リスト内の特定の項目にアクセス
# するには、Code Block を使用します。
code_block_4 = CodeBlock(output=python_script_2) { output[0]; output[1]; output[2]; }
watch_4 = Watch(code_block_4.out2)
watch_5 = Watch(code_block_4.out0)
watch_6 = Watch(code_block_4.out1)
