# Dynamo graph Core_RangeSyntax.dyn (Dynamo 3.0.0.6964)
# author: Dynamo Team
# このグラフは、等間隔の一連の数値または文字を生成する複数の方法を提供します。

# group: 情報
# note: 範囲構文
# 数値または文字のシーケンスとしてリストを作成する方法がいくつかあります。要素の配列を作成する場合、反復を作成する場合、および各種の関数や式の準備として、シーケンスを使用する場合に便利です。

# group: Code Block を使用します
# note: start..end..step
# step 2 の 0 から 10 まで
# このメソッドは Range ノードの使用と同じです
code_block = CodeBlock { 0..10..2; }
watch = Watch(code_block)
# note: start..end
# step 値が指定されていない場合は、1 と見なされます。
# このメソッドは Range ノードの使用と同じです
# note: Code Block ノードで範囲構文を使用します。複数の範囲構文と、一連の数字(または文字)を生成する複数の方法があります。
#         start..end..step
#         start..end..#amount
#         start..#amount..interval
# start = シリーズを開始する数字/文字
# end = シリーズを終了する数字/文字
# step = 2 つの連続する数字および文字の違い
# amount = シリーズにある数字/文字の量
code_block_2 = CodeBlock { 0..10; }
watch_2 = Watch(code_block_2)
# note: start..end..#amount
# 3 step の 0 から 10 まで
code_block_3 = CodeBlock { 0..10..#3; }
watch_3 = Watch(code_block_3)
# note: start..#amount..interval
# 0 から開始される 10 step、各 step は 3 に等しい
# このメソッドは、Sequence ノードの使用と同じです。
code_block_4 = CodeBlock { 0..#10..3; }
watch_4 = Watch(code_block_4)

# group: 動的な入力で Code Block を使用します
integer_slider = IntegerSlider(7, range=0..10 step 1)
# note: 値を変数に置き換え、スライダを使用してリストの長さを動的にコントロールします。
code_block_5 = CodeBlock(howMany=integer_slider) { 0..#howMany..3; }
watch_5 = Watch(code_block_5)

# group: Sequence を使用します
number = DoubleInput(0)
number_slider = DoubleSlider(8, range=0..10 step 0.1)
number_2 = DoubleInput(2)
# note: リスト内の項目数と各 step の長さが分かっている場合は、Sequence ノードを使用します。リストの最後結果は事前定義されていませんが、他の入力に基づいて計算されます。
# 例: 8 台分の駐車スペースがある駐車場の設計において、各駐車スペースは既知の幅です。すべての駐車場スペースの全体の幅は、各駐車スペースの個々の幅と数に依存します。
sequence = Sequence(start=number, amount=number_slider, step=number_2, lacing=Longest)
watch_6 = Watch(sequence)

# group: Range を使用します
number_3 = DoubleInput(0)
number_4 = DoubleInput(10)
number_slider_2 = DoubleSlider(1.75, range=0..10 step 0.1)
# note: シーケンスの開始と終了が分かっている場合は、Range ノードを使用します。結果リスト内の項目数は、他の入力に基づいて事前定義されていませんが、他の入力に基づいて計算されます。
# 追加の step によって step 値が 'end' を超える場合、リストの最後の項目が 'end' 入力と一致しない可能性があることに注意してください。
# 設定された 'start' と 'end' の間の step 値を増やすと項目が少なくなり、逆に step 値を減らすとリストの長さが長くなります。
range = Range(start=number_3, end=number_4, step=number_slider_2, lacing=Longest)
watch_7 = Watch(range)

# group: Strings で Range を使用します
string = StringInput("A")
string_2 = StringInput("P")
code_block_6 = CodeBlock { 1; }
# note: Range を使用して、文字のシーケンスを生成することもできます。
range_2 = Range(start=string, end=string_2, step=code_block_6, lacing=Longest)
watch_8 = Watch(range_2)

# group: Strings で Sequence を使用します
string_3 = StringInput("A")
code_block_7 = CodeBlock { 20; }
# note: Sequence ノードを使用して、アルファベット順に一連の文字を生成します
sequence_2 = Sequence(start=string_3, amount=code_block_7)
watch_9 = Watch(sequence_2)

# note: 値のシーケンスを使用して、一連の点群を作成します
byCoordinates = Point.ByCoordinates(x=code_block_5)
