# Dynamo graph Core_Strings.dyn (Dynamo 3.4.1.7055)
# author: Dynamo Team
# このグラフは、文字列に対して実行できるアクションを示します。

# group: 情報
# note: STRINGS
# この一連のサンプルは、Strings を使用して実行できるアクションを示します。String 演算子のその他のノードは、'String' カテゴリの下のノード ライブラリにあります。

byCoordinates = Point.ByCoordinates()
code_block = CodeBlock { 5; }
# note: オブジェクト「円」を作成します
byCenterPointRadius = Circle.ByCenterPointRadius(centerPoint=byCoordinates, radius=code_block)

# group: オブジェクトを String に変換します
# note: オブジェクトをそれ自体の文字説明に変換します。
string_from_object = FromObject(obj=byCenterPointRadius)

watch = Watch(string_from_object)

# group: セパレータを使用して文字列を分割します
code_block_2 = CodeBlock { "("; ")"; " "; "="; ","; }
# note: 1 つ以上のセパレータを指定して、文字列を複数に分割します。それぞれのセパレータには 1 つ以上の文字を使用できます。
split = String.Split(string=watch, separator0=code_block_2.out0, separator1=code_block_2.out1, separator2=code_block_2.out2, separator3=code_block_2.out3, separator4=code_block_2.out4)

watch_2 = Watch(split)

# group: String にサブストリングが含まれているかどうかを確認します
code_block_3 = CodeBlock { "."; }
# note: 文字列に別の文字列が含まれているかどうかを確認します。
contains = String.Contains(string=watch_2, searchFor=code_block_3)

watch_3 = Watch(contains)

# group: 文字列を作成します
# note: Code Block ノードを使用して文字列を作成します。引用符「""」で文字列値を区切ります。
code_block_4 = CodeBlock { "Few things are harder to put up with than a good example."; }

# group: 大文字に変更します
string = StringInput(" - Mark Twain")
# note: 文字列の大文字/小文字を変更
toUpper = String.ToUpper(string=string)
watch_4 = Watch(toUpper)

# group: 連結
# note: 2 つの文字列を 1 つにアタッチすることを「連結する」または「連結」と呼びます。
concat = String.Concat(string0=code_block_4, string1=watch_4)

watch_5 = Watch(concat)

# group: 文字列内の文字を置き換えます
code_block_5 = CodeBlock { "put"; }
code_block_6 = CodeBlock { "come"; }
# note: 置換文字列を使用して、サブストリングのすべての出現数を減算します。
replace = String.Replace(string=watch_5, searchFor=code_block_5, replaceWith=code_block_6)

watch_6 = Watch(replace)

# group: 文字列内のサブストリングを検索します
code_block_7 = CodeBlock { " to"; }
# note: 特定のサブストリングが文字列内のどこにあるのかを検索します。結果はサブストリングが始まるインデックスです。
indexOf = String.IndexOf(string=watch_6, searchFor=code_block_7)
watch_7 = Watch(indexOf)

# group: 文字列の長さ
# note: 文字列の文字の合計数を求めます。
length = String.Length(string=watch_6)
watch_8 = Watch(length)

# note: 文字列の長さの合計から文字列の最初の部分を減算します。
sub = watch_8 - watch_7

# group: 文字を削除します
# note: 文字列から特定数の文字を削除します。
remove = String.Remove(string=watch_6, startIndex=watch_7, count=sub)

# group: 出現数をカウントします
watch_9 = Watch(remove)
code_block_8 = CodeBlock { "ar"; }
# note: 文字列内のサブストリングの出現数をカウントします。
countOccurrences = String.CountOccurrences(string=watch_9, searchFor=code_block_8)
watch_10 = Watch(countOccurrences)

# group: 文字列を作成します
# note: If the string includes a " character, use an escape character \ before " to treat it as a part of the string and not the end of the string.
code_block_9 = CodeBlock { "There is no \"I\" in Team"; }
watch_11 = Watch(code_block_9)

数値の範囲 = CodeBlock { 2..101; }

# group: 'Add' を使用して文字列を連結します
code_block_10 = CodeBlock { " Dalmatians"; }
# note: 'Add' 演算子は自動的に数値を文字列に変換し、連結を実行します。
add = 数値の範囲 + code_block_10
watch_12 = Watch(add)

# group: オブジェクトを文字列に変換します
# note: 場合によっては、最初にオブジェクトを文字列に変換する必要があります。
string_from_object_2 = FromObject(object=数値の範囲)
watch_13 = Watch(string_from_object_2)
type = Object.Type(object=string_from_object_2)
watch_14 = Watch(type)

# group: 文字列を数値に変換します
code_block_11 = CodeBlock { "101 Dalmatians"; }
code_block_12 = CodeBlock { " "; }
# note: スペースをセパレータとして使用し、文字列を単語に分割します
split_2 = String.Split(string=code_block_11, separator0=code_block_12)
# note: リストから最初の項目を取得します
firstItem = List.FirstItem(list=split_2)
# note: 文字列を数値に変換します
toNumber = String.ToNumber(string=firstItem)
watch_15 = Watch(toNumber)
type_2 = Object.Type(object=toNumber)
watch_16 = Watch(type_2)

# group: 文字列を数値に変換します
# note: ブール値リストをフィルタリングのマスクとして使用し、リスト内のすべての数値を取得します
filterByBoolMask = List.FilterByBoolMask(list=watch_2, mask=contains)
# note: 文字列を数値に変換します
toNumber_2 = String.ToNumber(string=filterByBoolMask.in)

watch_17 = Watch(filterByBoolMask.in)
