# Dynamo graph Geometry_Curves.dyn (Dynamo 3.1.0.3411)
# author: Dynamo Team
# 基本的な曲線プリミティブ(Line、Polycurve、開いた NURBS 曲線と閉じた NURBS 曲線)の作成方法を示すサンプル グラフ

# group: 情報
# note: このグラフは、基本的な Curve プリミティブ(Line、Polycurve、開いた NURBS 曲線、閉じた NURBS 曲線)を作成する方法を示します

# group: 初期入力
number = DoubleInput(5)
number_2 = DoubleInput(10)
number_3 = DoubleInput(15)

# group: 初期の 4 点
byCoordinates = Point.ByCoordinates()
byCoordinates_2 = Point.ByCoordinates(y=number)
byCoordinates_3 = Point.ByCoordinates(x=number_2, y=number_2)
byCoordinates_4 = Point.ByCoordinates(x=number_3)

# group: 4 点のリスト
create = List.Create(item0=byCoordinates, item1=byCoordinates_2, item2=byCoordinates_3, item3=byCoordinates_4)

# group: NURBS 曲線
# note: 4 点で NURBS 曲線を作成します
byPoints = NurbsCurve.ByPoints(points=create)

# group: 線分
# note: 2 点による単一の直線
byStartPointEndPoint = Line.ByStartPointEndPoint(startPoint=byCoordinates, endPoint=byCoordinates_2)

length = Curve.Length(curve=byStartPointEndPoint)

# group: NURBS 曲線 - 閉
boolean = BoolSelector(true)
# note: 境界点の内側に閉じた NURBS 曲線を作成します
byControlPoints = NurbsCurve.ByControlPoints(points=create, closeCurve=boolean)

# group: ポリカーブ
# 説明<グループの説明を編集するにはここをダブル クリック>
# note: 一連の点群を通る直線ポリカーブを作成します
# note: 新規注記
byPoints_2 = PolyCurve.ByPoints(points=create)

# group: Action と Query
code_block = CodeBlock { 0..1..#20; }
# note: Curve、Polycurve (Curve の集合)、Nurb、Line はすべて「Curve」から派生したものです。そのため、これらにはすべての Curve 「Action」と「Query」を実行できます
pointAtParameter = Curve.PointAtParameter(curve=byPoints_2, param=code_block)
