# Dynamo graph Geometry_Points.dyn (Dynamo 3.1.0.3411)
# author: Dynamo Team
# 点群の配列を作成します

# group: 初期入力
number_slider = DoubleSlider(6.4, range=0..10 step 0.1)

# group: 単一点
# note: 基本的なジオメトリック要素には、数値入力の既定値があります。ノード入力ポートにカーソルを合わせて既定値を確認してください。
byCoordinates = Point.ByCoordinates(z=number_slider)

# group: 結果をプレビュー
# note: [実行]を押すか、[自動実行]を有効にして、ジオメトリ エンティティをバックグラウンド プレビュー、Watch 3D、または Watch ノードのデータとして表示します。要素は、ノードが選択されるとバックグラウンドで強調表示されます。
watch_3d = Watch3D(byCoordinates)

# group: 初期入力
number = DoubleInput(0)
number_2 = DoubleInput(10)
number_3 = DoubleInput(1)

# group: 数値の範囲
# note: Sequence、Range、Listを使用して Geometry の配列を作成できます
range = Range(start=number, end=number_2, step=number_3, lacing=Longest)

# group: 点群の行列
# note: Range を x、y、z ポートの点群に渡し、ノードの右クリック メニューでレーシング プロパティを変更して、1、2、3 次元配列を作成します。結果は、[外積レーシング]オプションを選択したときに確認できます。
byCoordinates_2 = Point.ByCoordinates(x=range, y=range, lacing=CrossProduct)

watch = Watch(byCoordinates)

# group: 点をベクトルに変換します
# 説明<グループの説明を編集するにはここをダブル クリック>
# note: 一部の要素は他の要素に簡単に変換できます。
asVector = Point.AsVector(point=watch)

# group: ベクトルとして点ごとに行列を移動します
# note: エンティティの Action カテゴリ内のツールを使用すると派生要素を作成できます
add = Point.Add(point=byCoordinates_2, vectorToAdd=asVector)

# group: 点の 'Z' 座標をプレビュー
# note: 情報は、各ノード グループの Query サブカテゴリ(疑問符の横)内のノードを使用して、ジオメトリから抽出できます。
Z = Point.Z(point=byCoordinates)
