# Dynamo graph Geometry_Solids.dyn (Dynamo 3.1.0.3411)
# author: Dynamo Team
# ロフトとソリッド操作(加算と減算)を使用したソリッド作成を示す Dynamo のサンプル グラフ

# group: 1 番目の曲線グループの初期点
byCoordinates = Point.ByCoordinates()
number = DoubleInput(10)
byCoordinates_2 = Point.ByCoordinates(x=number)
byCoordinates_3 = Point.ByCoordinates(y=number)

# group: 2 番目の曲線グループの追加点
number_2 = DoubleInput(5)
byCoordinates_4 = Point.ByCoordinates(z=number_2)

# group: 下基準の初期曲線を作成します
byStartPointEndPoint = Line.ByStartPointEndPoint(startPoint=byCoordinates, endPoint=byCoordinates_2)
byThreePoints = Arc.ByThreePoints(firstPoint=byCoordinates, secondPoint=byCoordinates_4, thirdPoint=byCoordinates_2)

# group: 下基準を作成します
create = List.Create(item0=byStartPointEndPoint, item1=byThreePoints)
byJoinedCurves = PolyCurve.ByJoinedCurves(curves=create)

# group: 3 番目の曲線グループの追加点
number_3 = DoubleInput(15)
byCoordinates_5 = Point.ByCoordinates(x=number_3, y=number_3)

# group: 4 番目の曲線グループの追加点
number_4 = DoubleInput(5)
number_5 = DoubleInput(10)
byCoordinates_6 = Point.ByCoordinates(x=number_4, y=number_5, z=number_5)

# group: 上基準の初期曲線を作成します
byStartPointEndPoint_2 = Line.ByStartPointEndPoint(startPoint=byCoordinates_3, endPoint=byCoordinates_5)
byThreePoints_2 = Arc.ByThreePoints(firstPoint=byCoordinates_3, secondPoint=byCoordinates_6, thirdPoint=byCoordinates_5)

# group: 上基準を作成します
create_2 = List.Create(item0=byStartPointEndPoint_2, item1=byThreePoints_2)
byJoinedCurves_2 = PolyCurve.ByJoinedCurves(curves=create_2)

# group: 基準曲線をリストに結合します
create_3 = List.Create(item0=byJoinedCurves, item1=byJoinedCurves_2)

# group: ロフト
# note: ほとんどの Solid で複数の作成方法が使用できます。次の例では、Closed Profile をベースに使用していますが、ポリサーフェスをステッチしたり、多くのプリミティブ(Surface、Cuboid、Cone など)を使用することができます
byLoft = Solid.ByLoft(crossSections=create_3)

# group: 容積
# note: ロフトの体積を確認して、閉じたソリッド ジオメトリであることを示すことができます
volume = Solid.Volume(solid=byLoft)

# group: 追加のロフト ジオメトリの追加点
number_6 = DoubleInput(-2)
number_7 = DoubleInput(5)
byCoordinates_7 = Point.ByCoordinates(x=number_6, y=number_7)

# group: 点群をリストに結合します
create_4 = List.Create(item0=byCoordinates, item1=byCoordinates_7, item2=byCoordinates_3)

# group: 追加の基準曲線を作成します
# 説明<グループの説明を編集するにはここをダブル クリック>
# note: 今度は、点郡のグループから NURBSE 曲線を作成します
byPoints = NurbsCurve.ByPoints(points=create_4)

# group: ロフト +
# note: ヒント: ノードの右クリック メニューで[プレビュー]をオフにすると、表示から要素を除外できます
byLoft_2 = Solid.ByLoft(crossSections=create_3, guideCurves=byPoints)

# group: ジオメトリ +
code_block = CodeBlock { Vector.ByCoordinates(-20,0,0); }
# note: ジオメトリを移動して出力を視覚化します
translate = Geometry.Translate(geometry=byLoft_2, direction=code_block)

# group: ソリッド ジオメトリをトリムするために 'ingredients' を準備します
# note: 厚さ
code_block_2 = CodeBlock { 0; }
# note: ヒント: ノードの右クリック メニューで[プレビュー]をオフにすると、表示から要素を除外できます
thinShell = Solid.ThinShell(solid=byLoft, internalFaceThickness=code_block_2)
code_block_3 = CodeBlock { Vector.ByCoordinates(20,0,0); }
# note: ジオメトリを X 方向に 20 単位移動します
translate_2 = Geometry.Translate(geometry=thinShell, direction=code_block_3)
code_block_4 = CodeBlock { Point.ByCoordinates(0,0,5); }
ZAxis = Vector.ZAxis()
# note: ソリッドを通過する平面を作成してカット
byOriginNormal = Plane.ByOriginNormal(origin=code_block_4, normal=ZAxis)
# note: この点は、トリムするソリッドの一部を決定します
code_block_5 = CodeBlock { Point.ByCoordinates(10,10,10); }

# group: ロフト -
# note: ジオメトリのブール演算(積、差、和など)は、Geometry Category で使用できます。
trim = Geometry.Trim(geometry=translate_2, other=byOriginNormal, pick=code_block_5)
