# Dynamo graph Geometry_Surfaces.dyn (Dynamo 3.1.0.3411)
# サーフェスを作成する主な方法(Extrude、Loft、Sweep)を示す Dynamo グラフです。

# group: 情報
# note: Dynamo グラフには、サーフェスを作成する主な方法(Extrude、Loft、Sweep)が表示されます。

# group: 入力
number = DoubleInput(10)
number_2 = DoubleInput(-10)
byCoordinates = Point.ByCoordinates(x=number, y=number_2)
byCoordinates_2 = Point.ByCoordinates(y=number_2)

# group: 線分
byStartPointEndPoint = Line.ByStartPointEndPoint(startPoint=byCoordinates, endPoint=byCoordinates_2)

# group: 入力
byCoordinates_3 = Point.ByCoordinates()

# group: 入力
number_3 = DoubleInput(5)
byCoordinates_4 = Point.ByCoordinates(z=number_3)

# group: 入力
number_4 = DoubleInput(10)
byCoordinates_5 = Point.ByCoordinates(x=number_4)
byCoordinates_6 = Point.ByCoordinates(y=number_4)

# group: 円弧
byThreePoints = Arc.ByThreePoints(firstPoint=byCoordinates_3, secondPoint=byCoordinates_4, thirdPoint=byCoordinates_5)

# group: ロフト
create = List.Create(item0=byStartPointEndPoint, item1=byThreePoints)
# note: 2 つの曲線セットを使用して、曲線間に 'Loft' ジオメトリを作成できます
byLoft = Surface.ByLoft(crossSections=create)

# group: ロフト領域を評価します
area = Surface.Area(surface=byLoft)
watch = Watch(area)

# group: 入力
number_5 = DoubleInput(5)
number_6 = DoubleInput(10)
byCoordinates_7 = Point.ByCoordinates(x=number_5, y=number_6, z=number_6)

# group: 入力
number_7 = DoubleInput(15)
byCoordinates_8 = Point.ByCoordinates(x=number_7, y=number_7)

# group: 円弧
byThreePoints_2 = Arc.ByThreePoints(firstPoint=byCoordinates_6, secondPoint=byCoordinates_7, thirdPoint=byCoordinates_8)

# group: 入力
number_8 = DoubleInput(-5)
number_9 = DoubleInput(5)
byCoordinates_9 = Point.ByCoordinates(x=number_8, y=number_9)

# group: 円弧
byThreePoints_3 = Arc.ByThreePoints(firstPoint=byCoordinates_3, secondPoint=byCoordinates_9, thirdPoint=byCoordinates_6)

# group: スイープ
# note: ほとんどの Surface で、複数の作成方法を使用できます。Point、Curve で Surface、Polysurface (Surface の集合)、Nurbs Surface を作成したり、他のサーフェスやソリッドから派生させたりできます
bySweep2Rails = Surface.BySweep2Rails(path=byThreePoints_2, guideRail=byThreePoints, profile=byThreePoints_3)

# group: ロフトとスイープを結合します
create_2 = List.Create(item0=byLoft, item1=bySweep2Rails)
# note: Polysurfaces として結合されたサーフェスは 1 つのエンティティとして評価できます
byJoinedSurfaces = PolySurface.ByJoinedSurfaces(surfaces=create_2)

# group: ロフト+スイープ領域の組み合わせを評価します
area_2 = Surface.Area(surface=byJoinedSurfaces)
watch_2 = Watch(area_2)

# group: スイープ領域を評価します
area_3 = Surface.Area(surface=bySweep2Rails)
watch_3 = Watch(area_3)

# group: サーフェスから点を抽出して使用します
code_block = CodeBlock { 0..1..0.1; }
# note: これらのジオメトリに最適な「Action」を使用すると、Surface から Edge、Point、その他のフィーチャを派生させることができます
pointAtParameter = Surface.PointAtParameter(surface=bySweep2Rails, u=code_block, v=code_block, lacing=CrossProduct)
# note: 抽出されたパラメータ(点)で新しい NURBS サーフェスを作成します。
# 残りのジオメトリを非表示にして、以下の結果を確認します。
byControlPoints = NurbsSurface.ByControlPoints(controlVertices=pointAtParameter)
watch_3d = Watch3D(byControlPoints)

# group: 押し出し
code_block_2 = CodeBlock { 10; }
# note: 指定された曲線からの基本的な押し出し
extrude = Curve.Extrude(curve=byThreePoints_2, distance=code_block_2)
