# Dynamo graph ImportExport_CSV to Stuff.dyn (Dynamo 3.1.0.3411)
# author: Dynamo Team
# 解析済み CSV データに基づいてジオメトリを作成します

# group: 初期 helix.csv 入力
# note: x、y、z 座標をスペース内の数値を
# 持つ CSV ファイルを参照
file_path = Filename("..\..\Data\helix.csv")

# group: ファイルを読み込みます
fromPath = FileObject(path=file_path)  # "File.FromPath"
readText = FileSystem.ReadText(file=fromPath)

# group: CSV データを解析します
string = StringInput("\n")
# note: 改行<enter>で
# 文字列を分割
split = String.Split(string=readText, separator0=string)
string_2 = StringInput(",")
# note: カンマで文字列を分割
split_2 = String.Split(string=split, separator0=string_2)
# note: CSV ファイルは String を提供し、数値を提供しません
toNumber = String.ToNumber(string=split_2)
# note: グループ X、Y、Z コンポーネント
transpose = List.Transpose(lists=toNumber)

# group: CSV ファイルから取得した点に基づいて、'spiral' ジオメトリを作成します
# note: 'X' 座標
firstItem = List.FirstItem(list=transpose)
code_block = CodeBlock { 1; }
# note: 'Y' 座標
getItemAtIndex = List.GetItemAtIndex(list=transpose, index=code_block)
# note: 'Z' 座標
lastItem = List.LastItem(list=transpose)
byCoordinates = Point.ByCoordinates(x=firstItem, y=getItemAtIndex, z=lastItem)

# group: スケール アップ
number_slider = DoubleSlider(2.337, range=0..20 step 0.1)
# note: 座標点の全体的な
# 分配を調整
scale = Geometry.Scale(geometry=byCoordinates, amount=number_slider, lacing=Longest)
