# Dynamo graph ImportExport_Excel to Dynamo.dyn (Dynamo 3.1.0.3411)
# author: Dynamo Team
# Excel から Dynamo にデータをインポートする方法を示すサンプル グラフです。

# group: 初期入力
# note: データのロード元の .xlsx Excel ファイル パスを参照します。
file_path = Filename("..\..\Data\helix.xlsx")
# note: ファイル パスからファイルを取得します。
fromPath = FileObject(path=file_path)  # "File.FromPath"
# note: 読み込むデータを含む Excel のワークシート名。
string = StringInput("helix")

# group: Excel データ読み込みます
# note: このノードは、Excel ワークシートから取得したデータを読み取ることができます。すべての列と行から読み取り、その結果のデータは double array [][] (matrix) に含まれます。
importExcel = Data.ImportExcel(file=fromPath, sheetName=string)

# group: 転置
# note: リスト(行列)を反転(転置)します。列は行になり、行は列になります。
transpose = List.Transpose(lists=importExcel)

# group: 点群の座標を抽出します
number = DoubleInput(0)
# note: X 座標
getItemAtIndex = List.GetItemAtIndex(list=transpose, index=number)
number_2 = DoubleInput(1)
# note: Y 座標
getItemAtIndex_2 = List.GetItemAtIndex(list=transpose, index=number_2)
number_3 = DoubleInput(2)
# note: Z 座標
getItemAtIndex_3 = List.GetItemAtIndex(list=transpose, index=number_3)

# group: Excel から抽出したデータに基づいてらせんを作成します
byCoordinates = Point.ByCoordinates(x=getItemAtIndex, y=getItemAtIndex_2, z=getItemAtIndex_3, lacing=Longest)
