# Dynamo graph OpenXMLExport_Data To Excel.dyn "OpenXMLExport_Data から Excel" (Dynamo 3.0.3.7594)
# author: Dynamo Team
# Excel にデータを書き出す方法を示す Dynamo のサンプル グラフです。

# group: 初期入力
# note: 点の数を駆動します。らせんの「高さ」と考えてください。
number_slider = DoubleSlider(1.7, range=0..5 step 0.1)

# group: らせんを作成します
# note: 0 から始まる一連の数値を作成します。増分は 10 です。点の数は 360 で乗算されます。このため、'numCircles' 力が 1 の場合、結果は 37 個の数値(0～360)となり、らせんの完全な回転が得られます。
code_block = CodeBlock(numCircles=number_slider) { 0..(360*numCircles)..10; }
# note: 余弦関数
cos = Math.Cos(angle=code_block, lacing=Longest)
# note: 正弦関数
sin = Math.Sin(angle=code_block, lacing=Longest)
# note: 100 で割る
code_block_2 = CodeBlock(x=code_block) { x/100; }
# note: 点群のリストを作成します。X コンポーネントは余弦、Y コンポーネントは正弦、Z コンポーネントは初期値を 100 で割った値です。
byCoordinates = Point.ByCoordinates(x=cos, y=sin, z=code_block_2, lacing=Longest)
# note: 点のリストからリスト構造を作成します。結果は 3 つのリスト([][] - dobule array)を含むリストで、それぞれに X、Y、Z の各点の座標が含まれます。
code_block_3 = CodeBlock(pt=byCoordinates) { [pt.X,pt.Y,pt.Z]; }

# group: 書き出し用の入力を作成します
# 1. csv ファイルへのファイル パス。
# 2. ワークシート名。
# 3. 点群の転置リスト。
# 4. Excel の行と列の開始インデックス。
# note: xlsx ファイルへのファイルパス。
file_path = Filename("..\..\Data\icosohedron_points.xlsx")
# note: Excel のワークシート名。
string = StringInput("helix")
# note: 行列を反転します(リストを転置します)。列は行になり、行は列になります。
transpose = List.Transpose(lists=code_block_3)
# note: Excel でデータの記録を開始する列および行の数
number = DoubleInput(0)

# group: データを Excel ファイルに書き出します
# note: データを Excel に書き出します。
openXMLExportExcel = Data.OpenXMLExportExcel(filePath=file_path, sheetName=string, data=transpose, startRow=number, startColumn=number)
