# Dynamo graph OpenXMLImport_Data From Excel.dyn "Excel から OpenXMLImport_Data" (Dynamo 3.1.0.3411)
# author: Dynamo Team
# Excel ファイルからデータをインポートする方法を示すサンプル グラフです。

# group: 初期入力
# 1. Excel ファイルへのファイルパス。
# 2. ワークシート名
file_path = Filename("..\..\Data\helix.xlsx")
string = StringInput("helix")

# group: Excel からデータを抽出します
# note: Excel からデータを読み込みます
openXMLImportExcel = Data.OpenXMLImportExcel(filePath=file_path, sheetName=string)

# group: Excel からデータを解析します
# 'Parsing' データは、使用前に環境にネイティブになるようにデータ ソースを操作するプロセスです。
# note: リストを転置(行列を反転)します。列は行、行は列になります。
transpose = List.Transpose(lists=openXMLImportExcel)
# note: 最初のリスト
number = DoubleInput(0)
# note: 2 番目のリスト
number_2 = DoubleInput(1)
# note: 3 番目のリスト
number_3 = DoubleInput(2)

# group: らせんを作成します
# note: X 座標
getItemAtIndex = List.GetItemAtIndex(list=transpose, index=number)
# note: Y 座標
getItemAtIndex_2 = List.GetItemAtIndex(list=transpose, index=number_2)
# note: Z 座標
getItemAtIndex_3 = List.GetItemAtIndex(list=transpose, index=number_3)
byCoordinates = Point.ByCoordinates(x=getItemAtIndex, y=getItemAtIndex_2, z=getItemAtIndex_3, lacing=Longest)
