# Dynamo graph Basics_Basic01.dyn (Dynamo 2.19.3.6543)
# author: Dynamo Team
# 노드를 연결하여 두 개의 번호를 추가합니다.

# note: 숫자 및 문자열과 같은 기본 함수 입력은 캔버스 왼쪽의 라이브러리에서 탐색하거나 검색하여 선택할 수 있습니다.
# 수학 또는 기하학적 변환 등 데이터에 실행되는 연산도 라이브러리에서 찾을 수 있습니다
# note: Dynamo는 시각적 프로그래밍 언어로, 다른 언어와 같이 간단한 요소를 연결하여 더 복잡한 아이디어를 형성하는 방식으로 사용됩니다
# note: Number 노드의 ">" 포트 밖으로 커넥터를 꺼내 + 노드의 "y" 포트에 연결한 다음, 응용프로그램 왼쪽 하단의 "실행" 버튼을 누르십시오.
number = DoubleInput(2)  # graph input
add = number + _  # unwired: y
# note: 데이터는 응용프로그램 오른쪽 하단에 있는 실행 버튼을 클릭하여 시각화할 수 있습니다. "자동" 실행 모드를 활성화하면 응용프로그램이 지속적으로 업데이트됩니다.
# Watch 노드를 사용하거나 대부분의 노드 하단에 있는 작은 정사각형을 클릭하면 데이터를 볼 수 있습니다.
watch = Watch(add)
# note: 도움말 메뉴에서 다른 샘플 파일을 확인하거나 탭의 "X"를 클릭하여 이 파일을 닫고 시작 페이지로 돌아가십시오
number_2 = DoubleInput(6)  # graph input
