# Dynamo graph Basics_Basic02.dyn (Dynamo 2.19.3.6543)
# author: Dynamo Team
# 두 점을 연결하여 선을 만듭니다.

# note: Dynamo 환경에서 점의 위치 조작: Point.ByCoordinates 노드를 선택하고 배경 미리보기로 전환하여 3개의 축을 따라 점을 당깁니다.
byCoordinates = Point.ByCoordinates()
# note: 기하학적 데이터는 텍스트 정보로 또는 3D 공간에서 시각화할 수 있습니다
watch = Watch(byCoordinates)
number = DoubleInput(2)  # graph input
# note: Number Slider 또는 Integer Slider 노드를 사용하여 지정된 범위 내에서 값을 동적으로 입력합니다. 파란색 드롭다운 화살표를 클릭하여 숫자 범위 설정을 엽니다.
number_slider = DoubleSlider(4.43, range=0..10 step 0.1)  # graph input
# note: 화면 오른쪽 상단에 있는 버튼을 사용하면 3D 배경 탐색과 그래프 뷰 탐색 간에 전환할 수 있습니다(바로 가기: Ctrl + B). Dynamo 및 Revit의 경우 뷰 메뉴에서 배경 미리보기를 켜고 끌 수도 있습니다.
byCoordinates_2 = Point.ByCoordinates(x=number, z=number_slider)
byStartPointEndPoint = Line.ByStartPointEndPoint(startPoint=byCoordinates_2, endPoint=byCoordinates)
# note: Watch 3D 노드를 사용하여 개별적으로 3D 요소 시각화
watch_3d = Watch3D(byStartPointEndPoint)
