# Dynamo graph Basics_Basic03.dyn (Dynamo 2.19.3.6543)
# author: Dynamo Team
# 단순 리스트를 작성합니다.

# group: 입력
# note: 데이터의 리스트는 시퀀스와 범위로 생성할 수 있습니다. 이러한 리스트는 특정 목적을 위해 다른 많은 노드와 함께 다시 구성할 수 있습니다.
number = DoubleInput(0)  # graph input
number_2 = DoubleInput(9)  # graph input
number_3 = DoubleInput(1)  # graph input

# note: Start 부터 End 까지 지정된 Step으로 숫자 시퀀스를 작성합니다.
range = Range(start=number, end=number_2, step=number_3, lacing=Longest)
watch = Watch(range)
number_4 = DoubleInput(3)  # graph input
# note: 3의 길이로 리스트 분할
chop = List.Chop(list=range, lengths=number_4)
# note: 결과를 미리 보고 Watch 노드를 사용하여 리스트 구조를 관찰합니다.
watch_2 = Watch(chop)
# note: 리스트의 마지막 항목 가져오기
lastItem = List.LastItem(list=range)
watch_3 = Watch(lastItem)
