# Dynamo graph Core_AttractorPoint.dyn (Dynamo 3.0.0.6964)
# author: Dynamo Team
# 이 그래프는 어트랙터 점의 위치에 따라 크기가 결정되는 원통의 그리드를 만듭니다.

# group: 정보
# note: 어트랙터 점
# 어트랙터 점은 시스템에서 다른 요소의 특성에 영향을 주는 참조점(또는 요소)입니다. 어트랙터 점은 종종 마그넷처럼 작동합니다. 요소가 어트랙터에 가까울수록 어트랙터의 영향을 더 많이 받습니다.
# 이 예에서 원통의 높이와 지름은 각 원통과 움직이는 어트랙터 점 사이의 거리에 따라 결정됩니다. 어트랙터 점 주변의 실린더는 멀리 떨어진 실리보다 작습니다.
# 이 동작을 시각화하려면 어트랙터 점 입력의 두 개의 숫자 슬라이더를 이동합니다.
# 어트랙터 점은 설계 프로세스에 반응성과 동적 동작을 도입하는 방법입니다.

# group: 점 그리드 크기
# note: Code Block을 사용하여 숫자 시퀀스를 만듭니다. 이 경우 N 단계로 1에서 50까지의 숫자로 구성된 시퀀스가 생성되며, 각 단계는 5입니다.
숫자_범위 = CodeBlock { 1..50..5; }

# group: 점의 그리드 만들기
# note: 점의 그리드.
# 만들려면 일련의 숫자를 두 개의 포트(X 및 Y 좌표)에 전달합니다. 노드를 마우스 오른쪽 버튼으로 클릭하고 레이싱을 "외적"으로 변경합니다.
# note: 노드의 외적 레이싱은 한 리스트의 각 항목을 다른 모든 리스트의 각 항목과 결합하여 리스트의 그리드형 리스트 구조를 만듭니다.
# 'Point.ByCoordinates' 노드의 X 및 Y 입력과 함께 사용하면 결과는 단순한 점 그리드가 됩니다. 세 번째 Z 좌표를 사용하면 결과는 정육면체 모양의 점 그리드가 됩니다.
byCoordinates = Point.ByCoordinates(x=숫자_범위, y=숫자_범위, lacing=CrossProduct)

# group: 리스트 구조 단순화
# 점을 사용하는 추가 작업에는 복잡한 리스트 구조가 필요하지 않습니다. Flatten 노드를 사용하여 리스트를 하나만 생성하십시오.
# note: 행과 열의 계층 구조가 필요하지 않으므로 리스트를 단순화합니다. 이 노드에 대한 입력을 출력과 비교합니다. 그러면 N개의 리스트 구조가 단 하나의 리스트로 변경됩니다.
flatten = List.Flatten(list=byCoordinates)

# group: 어트랙터 점 위치
number_slider = DoubleSlider(24.6, range=-10..60 step 0.1)  # graph input
number_slider_2 = DoubleSlider(11.50111001, range=-10..60 step 0.1)  # graph input
# note: 어트랙터 점. 이 점의 위치를 조정하려면 입력 슬라이더를 이동합니다.
byCoordinates_2 = Point.ByCoordinates(x=number_slider, y=number_slider_2)

# group: 어트랙터까지 거리
# note: 원통의 어트랙터 점과 각 기준점 사이의 거리를 찾습니다.
distanceTo = Geometry.DistanceTo(geometry=flatten, other=byCoordinates_2)

# group: 반지름 및 높이 생성
# note: 원통의 높이가 어트랙터 점의 위치에 반응하도록 하는 수식. 이 예에서 각 원통의 높이는 어트랙터 점까지 거리의 절반입니다. 다른 수식을 사용해 보십시오.
원통_높이 = CodeBlock(x=distanceTo) { x/2; }
# note: 수식은 원통의 반지름으로 사용될 값을 반환합니다. 거리가 클수록 각 원통의 반지름이 커집니다. 다른 수식을 사용해 보십시오.
원통_반지름 = CodeBlock(x=distanceTo) { x/15; }

# group: 끝점
# 수식으로 정의된 각 원통의 시작점(원점)을 주어진 높이로 변환합니다.
# note: 기준점(원점)을 지정된 값만큼 위로 이동하는 벡터
byCoordinates_3 = Vector.ByCoordinates(z=원통_높이)
# note: 이 새 Z 값(높이)을 원래 그리드 점에 추가하여 원통의 맨 위 점을 얻습니다.
add = Point.Add(point=flatten, vectorToAdd=byCoordinates_3)

# group: 원통 만들기
# note: 지정된 시작점과 끝점 및 지정된 반지름을 가진 원통을 만드는 방법을 사용합니다.
byPointsRadius = Cylinder.ByPointsRadius(startPoint=flatten, endPoint=add, radius=원통_반지름)
