# Dynamo graph Core_CodeBlocks.dyn (Dynamo 3.4.1.7055)
# author: Dynamo Team
# 이 그래프는 Code Block의 다양한 용도와 적용을 살펴봅니다.

# group: 정보
# note: CODE BLOCK
# Code Block은 캔버스를 두 번 클릭하여 만들 수 있습니다. 노드 라이브러리의 Script > Editor 카테고리에서도 찾을 수 있습니다.
# Code Block에는 다음이 포함될 수 있습니다.
# •   숫자 값(정수 및 부동 소수점 숫자)
# •  문자열(문자)
# •  부울 값(True 또는 False)
# •  리스트  [0,1,2]
# •  표현식(a+3)
# •  변수
# 기타 노드는 Code Block 표현식으로 변환할 수 있습니다. 이렇게 하려면 노드를 한 개 이상 선택하고 노드 사이의 공간을 마우스 오른쪽 버튼으로 클릭하여 '노드를 코드로'를 선택합니다. 이 작업은 되돌릴 수 없습니다. Code Block을 노드로 자동 변환할 수 없습니다.

# group: Code Block으로서의 노드
# note: Code Block은 라이브러리의 다른 노드를 호출하는 데 사용할 수 있습니다. 라이브러리의 노드는 일반적으로 세 가지 유형으로 제공됩니다.
#     만들기:	무언가를 만듭니다.
#     작업:		무언가에 대한 작업을 수행합니다.
#     조회:		이미 존재하는 것의
# 		특성을 가져옵니다.
# 이 세 가지 유형의 메서드 또는 노드는 Code Block 내에서 호출될 때 다르게 취급됩니다.

# group: 형상 작성
# note: 이 문장들은 기준점에서 나선형 곡선을 만드는 알고리즘을 구성합니다.
code_block = CodeBlock()
# ---------- code_block.designscript (16 lines) ----------
// Basic inputs
base = Point.ByCoordinates(3,3);
coils = 3;
height = 5;
rad = 0.5;

// Make a series of points
numPts = 8*coils + 1;
seq = 0..(coils*360)..#numPts;
x = rad * Math.Cos(seq);
y = rad * Math.Sin(seq);
z = 0..height..#numPts;
pts = Point.ByCoordinates(x + base.X, y + base.Y, z + base.Z);

// Pass a curve through those points
NurbsCurve.ByPoints(pts);
# ----------------------------------------
# note: 나선 알고리즘은 이름, 입력 및 반환할 값을 지정하여 함수로 변환됩니다.
code_block_2 = CodeBlock()
# ---------- code_block_2.designscript (13 lines) ----------
def MakeSpring(base,coils,height,rad)
{
// Make a series of points
numPts = 8*coils + 1;
seq = 0..(coils*360)..#numPts;
x = rad * Math.Cos(seq);
y = rad * Math.Sin(seq);
z = 0..height..#numPts;
pts = Point.ByCoordinates(x + base.X, y + base.Y, z + base.Z);

// Return the curve that passes through those points
return = NurbsCurve.ByPoints(pts);
};
# ----------------------------------------
code_block_3 = CodeBlock { 0..6..2; }
code_block_4 = CodeBlock { 10..20..2; }
# note: 나선 알고리즘은 임의의 이름 "MakeSpring"을 갖는 함수를 정의하기 위해 변환됩니다. 이 함수는 임의의 높이를 가지며 그리드로 정렬되는 여러 개의 스프링을 만들기 위해 호출됩니다.
# note: 그리드를 만듭니다
byCoordinates = Point.ByCoordinates(x=code_block_3, y=code_block_4, lacing=CrossProduct)
flatten = List.Flatten(list=byCoordinates)
code_block_5 = CodeBlock { 5; }
count = List.Count(list=flatten)
# note: 스프링 높이에 대한 일련의 난수(5 간격)를 생성합니다
randomList = Math.RandomList(amount=count)
code_block_6 = CodeBlock(random=randomList) { random * 5; }
# note: 함수 호출의 입력은 항목의 리스트 또는 단일 값 항목으로 만들 수 있습니다. 데이터는 포트를 통해 전달하거나, 모든 스프링의 반지름에 대해 "0.5"를 지정하는 경우처럼 직접 선언할 수 있습니다.
code_block_7 = CodeBlock(basePoints=flatten, numCoils=code_block_5, height=code_block_6) { MakeSpring(basePoints,numCoils,height,0.5); }

# group: 함수
# note: 함수는 이 정의 내의 다른 위치에서 호출되도록 코드 블록 노드에서 직접 정의할 수 있습니다.
# 첫 번째 행에는 키워드 "def", 그 다음에 함수 이름, 그 다음에 괄호로 둘러싸인 입력이 나옵니다.
# 중괄호는 함수의 본문을 정의합니다. 각 행은 세미콜론으로 끝나야 합니다.
# 값은 "return = "을 사용하여 반환합니다.
code_block_8 = CodeBlock()
# ---------- code_block_8.designscript (11 lines) ----------
/* This is a multi-line comment,
     which continues for mulitple
     lines. */

def FunctionName(input1, input2)
{
// This is a comment
sum = input1 + input2;

return = sum;
};
# ----------------------------------------
code_block_9 = CodeBlock { 1; }
# note: 함수를 정의하는 코드 블록 노드가 다른 코드 블록 노드에서 호출되기 때문에 입력 또는 출력 포트가 없습니다.
code_block_10 = CodeBlock { 2; }
# note: 동일한 파일의 다른 코드 블록 노드에서 동일한 이름 및 동일한 개수의 인수를 지정하여 함수를 호출합니다.
code_block_11 = CodeBlock(in1=code_block_9, in2=code_block_10) { FunctionName(in1,in2); }
watch = Watch(code_block_11)
code_block_12 = CodeBlock { "cat"; }
code_block_13 = CodeBlock { "dog"; }
# note: 입력 인수의 유형은 함수 정의에 지정되지 않으므로, 수신되는 모든 항목에 적용됩니다.
code_block_14 = CodeBlock(in1=code_block_12, in2=code_block_13) { FunctionName(in1,in2); }
watch_2 = Watch(code_block_14)
origin = Point.Origin()
code_block_15 = CodeBlock { 16; }
# note: 함수에 대해 적합하지 않은 입력을 사용하여 해당 함수를 호출할 경우 null 결과가 생성됩니다.
code_block_16 = CodeBlock(in1=origin, in2=code_block_15) { FunctionName(in1,in2); }
watch_3 = Watch(code_block_16)

# group: 숫자 값
# 특수 목적 노드와 Code Block 비교
# note: 특수 목적
number = DoubleInput(3.14)
결과 = Watch(number)
# note: Code Block
code_block_17 = CodeBlock { 3.140; }
watch_4 = Watch(code_block_17)

# group: 문자열 값
# 특수 목적 노드와 Code Block 비교
# note: 특수 목적
string = StringInput("Less is more.")
결과_2 = Watch(string)
# note: 따옴표 ""를 사용하여 Code Block 노드가 있는 문자열 만들기
code_block_18 = CodeBlock { "Less is more."; }
watch_5 = Watch(code_block_18)
# note: 이 노드를 사용하여 출력 값 유형 보기
type = Object.Type(object=code_block_18)
watch_6 = Watch(type)

# group: 표현식
# 특수 목적 * 노드와 Code Block을 사용하여 곱셈 연산을 수행합니다.
number_2 = DoubleInput(3)
number_3 = DoubleInput(5)
# note: * 노드를 사용하여 두 숫자 곱하기
mul = number_2 * number_3
결과_3 = Watch(mul)
# note: Code Block을 사용하여 곱셈 수행
code_block_19 = CodeBlock { 3*5; }
watch_7 = Watch(code_block_19)
code_block_20 = CodeBlock { 3; }
code_block_21 = CodeBlock { 5; }
# note: 곱셈 연산에 대한 입력값으로 변수를 사용합니다.
code_block_22 = CodeBlock(a=code_block_20, b=code_block_21) { a*b; }
watch_8 = Watch(code_block_22)

# group: 조회
# 객체의 특성을 조회하고 반환하는 메서드입니다.
# note: 코드 블록을 사용하면 사용자가 입력 지정 방법을 원하는 대로 지정할 수 있습니다. 다음은, 예를 들어 동일한 점을 만드는 여러 가지 방법입니다.
code_block_23 = CodeBlock { 10; }
code_block_24 = CodeBlock { -10; }
# note: Point.ByCoordinates 노드를 사용하는 기본 제공 메서드
byCoordinates_2 = Point.ByCoordinates(x=code_block_23, y=code_block_24)
watch_9 = Watch(byCoordinates_2)
# note: Code Block은 X, Y 및 Z에 대한 세 개의 변수가 있는 Point.ByCoordinates 메서드를 사용합니다. 여기서 Z는 동일한 Code Block 내에서 정의되고 세미콜론 ';' 기호로 구분됩니다.
code_block_25 = CodeBlock(x=code_block_23, y=code_block_24) { z = 0; Point.ByCoordinates(x,y,z); }
watch_10 = Watch(code_block_25.out1)
code_block_26 = CodeBlock { Point.ByCoordinates(10,0,0); }
# note: 동일한 메서드에 해당하는 Code Block입니다. 조회 메서드에는 괄호가 필요하지 않습니다.
code_block_27 = CodeBlock(pt=code_block_26) { pt.X; }
watch_11 = Watch(code_block_27)
# note: 점의 X 좌표를 반환하는 기본 제공 조회 메서드
X = Point.X(point=code_block_26)
watch_12 = Watch(X)
# note: 여기에서 동일한 숫자 값의 음수 값을 사용하는 수식은 입력 변수의 표기법에 통합됩니다.
code_block_28 = CodeBlock(num=code_block_23) { Point.ByCoordinates(num,-num,0); }
watch_13 = Watch(code_block_28)
# note: Code Block은 세 가지 변수가 모두 입력으로 제공되는 Point.ByCoordinates 메서드를 사용합니다.
code_block_29 = CodeBlock { Point.ByCoordinates(10,-10,0); }
watch_14 = Watch(code_block_29)

# group: 작성
# 형상, 리스트, Revit 요소 또는 기타 객체를 만드는 메서드입니다.
# note: 원점에 점을 만드는 기본 제공 메서드
origin_2 = Point.Origin()
watch_15 = Watch(origin_2)
# note: 이 메서드에는 입력이 필요하지 않지만 괄호는 필요합니다.
code_block_30 = CodeBlock { Point.Origin(); }
watch_16 = Watch(code_block_30)
code_block_31 = CodeBlock { 0; -10; }
# note: X 및 Y 좌표를 제공하여 점을 만드는 기본 제공 메서드
byCoordinates_3 = Point.ByCoordinates(x=code_block_31.out0, y=code_block_31.out1)
watch_17 = Watch(byCoordinates_3)
# note: Code Block을 사용하여 Point.ByCoordinates 노드 동작을 복제합니다. 원래 기본 제공 노드 위에 마우스 커서를 올려놓으면 메서드 이름을 확인할 수 있습니다. 이 메서드는 툴팁 창의 맨 아래에 언급되어 있습니다.
# 입력은 기본 제공 노드에 있는 순서대로 지정해야 합니다.
code_block_32 = CodeBlock { Point.ByCoordinates(0,-10); }
watch_18 = Watch(code_block_32)

# group: 동작
# 객체에 대한 작업을 실행하는 메서드입니다.
origin_3 = Point.Origin()
ZAxis = Vector.ZAxis()
# note: 점에 벡터를 추가하는 기본 제공 메서드
add = Point.Add(point=origin_3, vectorToAdd=ZAxis)
watch_19 = Watch(add)
origin_4 = Point.Origin()
ZAxis_2 = Vector.ZAxis()
# note: 작업 메서드는 객체에 대해 수행됩니다. 객체 자체 뒤에 점 표기법을 사용하고, 첫 번째 입력 포트는 이미 가지고 있는 객체 자체이므로 첫 번째 입력 포트를 제외한 기본 제공 노드에 있는 모든 입력과 메서드를 지정하십시오.
code_block_33 = CodeBlock(pt=origin_4, vector=ZAxis_2) { pt.Add(vector); }
watch_20 = Watch(code_block_33)

# group: 리스트 만들기
# note: 리스트를 정의하고 쉼표로 개별 요소를 구분하기 위해 각괄호를 사용하여 리스트를 만듭니다.
code_block_34 = CodeBlock { ["San Francisco","New York","Chicago"]; }
watch_21 = Watch(code_block_34)
# note: list [ i ] 표기법을 사용하여 리스트에서 항목을 가져옵니다. 여기서 i는 항목의 색인입니다. 이 메서드는 GetItemAtIndex 노드를 사용하는 것과 같습니다.
code_block_35 = CodeBlock(cities=watch_21) { cities[2]; }
watch_22 = Watch(code_block_35)
# note: Multiple variables are defined in this code block, and at the end, a list is created containing all of them.
code_block_36 = CodeBlock()
# ---------- code_block_36.designscript (7 lines) ----------
str0 = "alpha";
str1 = "beta";
str2 = "charlie";
str3 = "delta";
str4 = "echo";
//
[str0,str1,str2,str3,str4];
# ----------------------------------------
watch_23 = Watch(code_block_36.out5)
code_block_37 = CodeBlock(phonetic=watch_23) { phonetic[2..3]; }
watch_24 = Watch(code_block_37)
code_block_38 = CodeBlock { 2; }
getItemAtIndex = List.GetItemAtIndex(list=watch_21, index=code_block_38)
watch_25 = Watch(getItemAtIndex)

# group: 리스트 결합 및 리스트 항목에 액세스
# 설명 <그룹 설명을 편집하려면 여기를 두 번 클릭하십시오.>
# note: 내포 리스트를 만들고 내포 리스트에서 항목을 가져옵니다.
code_block_39 = CodeBlock()
# ---------- code_block_39.designscript (6 lines) ----------
kitchen = ["table","stove","sink","refrigerator"];
livingRoom = ["sofa","books"];
bedroom = ["bed","dirty clothes"];
bathroom = ["tooth brush"];
//
allMyStuff = [kitchen, livingRoom, bedroom, bathroom];
# ----------------------------------------
watch_26 = Watch(code_block_39.allMyStuff)
# note: 세 번째 리스트 내의 두 번째 항목에 액세스합니다. 즉, 색인이 '2'인 리스트 내에서 색인이 '1'인 항목에 액세스합니다.
code_block_40 = CodeBlock(list=watch_26) { list[2][1]; }
watch_27 = Watch(code_block_40)

# group: 복제
# note: 복제 가이드는 리스트를 "외적"으로 레이싱되도록 지정하는 데 사용할 수 있습니다
code_block_41 = CodeBlock { x_vals = 0..10; y_vals = -30..-40; }
code_block_42 = CodeBlock(x_vals=code_block_41.x_vals, y_vals=code_block_41.y_vals) { Point.ByCoordinates(x_vals, y_vals); }
code_block_43 = CodeBlock { x_vals = 0..10; y_vals = -15..-25; }
code_block_44 = CodeBlock(x_vals=code_block_43.x_vals, y_vals=code_block_43.y_vals) { Point.ByCoordinates(x_vals<1>, y_vals<2>); }
byCoordinates_4 = Point.ByCoordinates(x=code_block_41.x_vals, y=code_block_41.y_vals)
byCoordinates_5 = Point.ByCoordinates(x=code_block_43.x_vals, y=code_block_43.y_vals, lacing=CrossProduct)
# note: 꺾쇠괄호를 사용하는 복제 가이드는 1차원 모음 2개 또는 3개를 사용하고 요소를 결합하여 1차원, 2차원 또는 3차원
# 모음을 생성합니다.
# note: 이 예에는 2개의 x 값과 5개의 y 값이 있습니다. 복제 가이드를 사용하면 결과 조합을 점 5개의 리스트 2개 또는 점 2개의 리스트 5개로 지정할 수 있습니다.
code_block_45 = CodeBlock()
# ---------- code_block_45.designscript (5 lines) ----------
x_vals = 0..1;
y_vals = -3..-7;
//
Point.ByCoordinates(x_vals<1>, y_vals<2>);
Point.ByCoordinates(x_vals<2>, y_vals<1>);
# ----------------------------------------
watch_28 = Watch(code_block_45.out2)
watch_29 = Watch(code_block_45.out3)

# group: 부울
# 특수 목적 노드와 Code Block 비교
# note: 부울 토글 노드
boolean = BoolSelector(true)
watch_30 = Watch(boolean)
# note: Code Block에서 'true' 또는 'false' 값을 사용하여 동일한 결과 달성
code_block_46 = CodeBlock { true; }
watch_31 = Watch(code_block_46)
