# Dynamo graph Core_ListAtLevel.dyn (Dynamo 3.1.0.3411)
# author: Dynamo Team
# List@Level과 이를 사용하여 List.Map 노드와 동일한 결과를 얻을 수 있는 방법에 대해 살펴봅니다. 일련의 패널을 만들어 List@Level의 실제 작동 방식을 보여줍니다.

# group: 정보
# note: 작업할 리스트 레벨을 결정하려면 미리보기 풍선 또는 Watch 노드 아래를 보고 List@Level 표기법의 행을 확인합니다.

# group: 정보
# List@Level 사용에 대한 일반 정보
# note: LIST@LEVEL
# List@Level은 작업할 리스트 레벨을 직접 선택할 수 있어 List.Map의 기능을 대치합니다.
# note: 작업하려는 리스트 레벨을 변경하려면 리스트 입력 포트 옆에 있는 화살표를 클릭하고 "레벨 사용" 옵션을 활성화합니다.
# 입력 포트에서 List@Level을 먼저 활성화하면, 안쪽에서 두 번째 레벨(L2)의 리스트가 작업용으로 선택됩니다.

# group: 정보
# 그래프 작동 방식
# note: 그리드 내부에 패널을 작성하려고 합니다. 그렇게 하려면, 가장 안쪽 레벨에 있는 각 리스트의 색인 1과 2에서 점을 얻어야 합니다. List@Level 기능을 사용하면 이를 쉽게 할 수 있습니다. "리스트 구조 유지" 옵션을 활성화하면 리스트의 그룹이 유지됩니다. 그러나 우선, Point.ByCoordinates로 작성한 리스트를 좀 더 검사하여 어떤 레벨의 리스트를 사용할지 결정하겠습니다.

# group: 입력
# 설명 <그룹 설명을 편집하려면 여기를 두 번 클릭하십시오.>
code_block = CodeBlock { 0..30..#8; 12..0..#4; }
# note: 이 예에서는 일련의 점이 포함된 3D 리스트를 작성했습니다. L3에 8개의 리스트가 있고, 각 리스트에는 다른 4개의 리스트(L2)가 포함되어 있습니다. 4개의 리스트 각각에는 4점(L1)이 포함되어 있으므로, 총 128개의 점이 작성되었습니다.
byCoordinates = Point.ByCoordinates(x=code_block.out0, y=code_block.out1, z=code_block.out1, lacing=CrossProduct)

# group: List@Level을 포함하는 List.Map 대치
code_block_2 = CodeBlock { [1,2]; }
# note: 이전 버전의 Dynamo에서는 List.Map을 사용하여 리스트의 내부 레벨을 얻었습니다. List.Map을 사용해도 같은 결과를 얻을 수 있지만, 그러면 작업공간에 더 많은 노드가 생성됩니다. 여기서는 그리드 내부 점을 더 효율적으로 사용할 수 있도록 List@Level을 사용합니다. 이러한 점을 사용하여 패널을 작성하겠습니다.
# 또한 원래 리스트의 그룹을 유지하고 단순화되는 것을 방지하기 위해 "리스트 구조 유지" 옵션을 사용했습니다. "리스트 구조 유지"를 비활성화하면 8개가 아니라 단일 NurbsSurface가 작성됩니다.
getItemAtIndex = List.GetItemAtIndex(list=byCoordinates@@L2, index=code_block_2)
code_block_3 = CodeBlock { [1,2]; }
# note: 리스트에는 여러 레벨에 있으며, L1이 가장 낮은 레벨입니다. 이 노드에서 생성한 총 요소 수는 오른쪽 하단에 표시된 것처럼 64입니다.
getItemAtIndex_2 = List.GetItemAtIndex(index=code_block_3)  # unwired: list
# note: 다음은 추가 노드가 필요한 List@Level을 적용하는 것과 동일한 List.Map입니다.
map = List.Map(f_x=getItemAtIndex_2)  # unwired: list
map_2 = List.Map(list=byCoordinates, f_x=map)

# group: 형상 작성
# note: 이제 선택된 점 세트로 패널을 작성할 수 있습니다.
byPoints = NurbsSurface.ByPoints(points=getItemAtIndex)
byBestFitThroughPoints = Line.ByBestFitThroughPoints(bestFitPoints=getItemAtIndex)

# group: List@Level 및 Count를 포함하는 리스트 검사
# note: List.Count 노드는 각 리스트에 존재하는 요소의 번호를 반환합니다. 선택한 레벨에 따라 서로 다른 값이 반환됩니다. L3 옆에 있는 화살표를 클릭하여 L3의 값을 변경해 보십시오.
# note: L3에는 각각 4개의 리스트가 포함된 8개의 리스트가 있습니다. 따라서, L3를 선택하면 8개의 리스트에서 List.Count 기능이 구현되어 '4' 값이 8개 나열됩니다.
count = List.Count(list=byCoordinates@L3)

# group: "리스트 구조 유지" 사용
# note: 이 노드는 L2의 각 리스트에 존재하는 요소의 번호를 반환합니다. 기본적으로 결과는 1D 리스트로 단순화됩니다.
count_2 = List.Count(list=byCoordinates@L2)
# note: 리스트의 내포된 구조를 유지하려면 "리스트 구조 유지" 옵션을 선택합니다. "@@"는 DesignScript에서 리스트 구조를 유지하는 방법을 나타냅니다.
count_3 = List.Count(list=byCoordinates@@L2)

# group: List@Level 및 Flatten을 포함하는 리스트 검사
# note: 또 다른 예로, List@Level 기능을 Flatten 노드와 함께 사용하면 리스트의 안쪽 레벨에 내포된 구조를 쉽게 단순화할 수 있습니다. List@Level 스피너 옆에 있는 화살표를 클릭하여 어떤 레벨이 단순화될지 변경해 보십시오.
# note: L3을 선택하면 해당 레벨의 리스트 8개가 1D 배열로 변환됩니다. 그러면, 8개의 리스트 각각에 4개의 항목(이 항목도 나열됨)이 포함되어 있으므로 L3의 리스트가 모두 단순화되어 16개의 점이 있는 8개의 리스트가 생성됩니다.
flatten = List.Flatten(list=byCoordinates@L3)
