# Dynamo graph Core_ListLacing.dyn (Dynamo 3.1.0.3411)
# author: Dynamo Team
# 리스트 레이싱 - 이 그래프에 리스트 레이싱의 모든 모드가 나와 있습니다.

# group: 정보
# note: 리스트 레이싱
# 레이싱은 Dynamo 노드에서 항목을 다른 리스트와 일치시키기 위해 사용하는 논리입니다. Dynamo에 있는 대부분의 노드에서는 "레이싱 동작"을 설정하여 정보 리스트를 결합하는 방법을 선택할 수 있습니다.
# 이들 각 예에는 Line.ByStartPointEndPoint 노드로 전달되는 두 개의 점 리스트가 있습니다. 선을 만드는 노드에서는 그릴 선의 수 및 그 사이에 선을 그릴 점 세트를 지정해야 합니다.
# 두 개 이상의 입력 포트가 있는 노드를 마우스 오른쪽 버튼으로 클릭하고 "레이싱"을 선택하여 레이싱 동작을 설정하십시오

# group: 팁
# note: 팁: 형상을 만드는 모든 노드에 대해 항목 인덱스를 배경 미리보기에서 레이블로 표시하십시오. 마우스 오른쪽 버튼을 클릭하고 "레이블 표시"를 선택하십시오

# group: 팁
# note: 팁: 노드의 레이싱 동작은 노드의 오른쪽 하단 모서리에 작은 그림 문자로 표시됩니다. 그림 문자가 표시되지 않는 경우에는 노드에서 레이싱을 수행하지 않습니다.

# group: 입력
# note: 더 긴 시리즈(요소 10개)
code_block = CodeBlock { 0..9; }
code_block_2 = CodeBlock { 4; }
# note: 더 짧은 시리즈(요소 6개)
code_block_3 = CodeBlock { 0..5; }
code_block_4 = CodeBlock { 0..9; }
code_block_5 = CodeBlock { -10; 4; }
code_block_6 = CodeBlock { 0..5; }
code_block_7 = CodeBlock { 0..9; }
code_block_8 = CodeBlock { 10; 4; }
code_block_9 = CodeBlock { 0..5; }

# group: 점 만들기
# Line.ByStartPointEndPoint에 대한 입력으로 사용할 (10 x 6)의 점 세트 2개를 만듭니다.
byCoordinates = Point.ByCoordinates(x=code_block, z=code_block_2)
byCoordinates_2 = Point.ByCoordinates(x=code_block_3)

# group: 최장 레이싱
# note: 최장 레이싱
# 더 긴 입력 점 리스트의 항목 수만큼 선이 그려집니다. 더 짧은 리스트에 더 이상 점이 없을 경우 노드에서는 가장 긴 리스트의 나머지 항목을 일치시키기 위해 필요한 수만큼 마지막 항목을 복사합니다.
byStartPointEndPoint = Line.ByStartPointEndPoint(startPoint=byCoordinates, endPoint=byCoordinates_2, lacing=Longest)

# group: 점 만들기
# Line.ByStartPointEndPoint에 대한 입력으로 사용할 (10 x 6)의 점 세트 2개를 만듭니다.
byCoordinates_3 = Point.ByCoordinates(x=code_block_4, y=code_block_5.out0, z=code_block_5.out1)
byCoordinates_4 = Point.ByCoordinates(x=code_block_6, y=code_block_5.out0)

# group: 최단 레이싱
# note: 최단 레이싱
# 선은 가장 짧은 입력 리스트의 항목 수만큼만 그려집니다. 더 긴 리스트에 "남아 있는" 점은 무시됩니다.
byStartPointEndPoint_2 = Line.ByStartPointEndPoint(startPoint=byCoordinates_3, endPoint=byCoordinates_4)

# group: 점 만들기
# Line.ByStartPointEndPoint에 대한 입력으로 사용할 (10 x 6)의 점 세트 2개를 만듭니다.
byCoordinates_5 = Point.ByCoordinates(x=code_block_7, y=code_block_8.out0, z=code_block_8.out1)
byCoordinates_6 = Point.ByCoordinates(x=code_block_9, y=code_block_8.out0)

# group: 외적 레이싱
# note: 외적 레이싱
# 가능한 모든 쌍의 조합이 작성됩니다. 긴 리스트에 10개의 점이 있고 짧은 리스트에 6개의 점이 있는 경우 10 x 6 = 60개의 선이 생성됩니다.
byStartPointEndPoint_3 = Line.ByStartPointEndPoint(startPoint=byCoordinates_5, endPoint=byCoordinates_6, lacing=CrossProduct)
# note: 생성된 선은 선 10개의 리스트 6개 또는 선 6개의 리스트 10개 중 먼저 정의된, 내포된 리스트에 저장됩니다.
watch = Watch(byStartPointEndPoint_3)
