# Dynamo graph Core_Math.dyn (Dynamo 3.4.1.7055)
# author: Dynamo Team
# Dynamo의 다양한 수학 함수 및 기능에 대해 자세히 살펴봅니다.

# group: 정보
# note: 수학
# Dynamo의 수학은 수학 라이브러리 및 연산자 라이브러리의 노드 또는 Code Block을 사용하여 수행할 수 있습니다. 아래에서 이 세 가지 방법을 각각 사용하여 몇 가지 기본적인 수학 연산을 수행하는 방법을 확인하십시오.

# group: 기본 산술 연산자
# note: 산술 연산자. 예:
# +, -, *, /, %

# group: 기본 논리 연산자
# note: 비교 연산자. 예:
# <, >, <=, >=, !=, ==

# group: 부울 연산자
# note: 부울 연산자
# (라이브러리에서 다른 연산자를 찾아보십시오.)

# group: 반올림
# note: 반올림

# group: 복잡한 수학 함수
# Nodes, Python, Fo를 사용하여 동일한 최종 결과를 얻는 4가지 예
# note: This example shows four different ways to approach dealing with Math functions.  Each of these examples starts with a grid of points, calculates z-coordinates for the points and then makes a surface.  Only the calculation method differs; these methods all solve the same.
# 1. Nodes. Math nodes are in the Math section of the Library which is further split into Functions, Logic and Operators.
# 2. Python.
# 3. Code Block Node.  Double-click anywhere in the canvas to create a code block node.  Syntax for each function matches the name of the node in Dynamo.
# ** Note: You can adjust the resolution of the geometry preview by navigating to the Render Precision settings: Dynamo -> Preferences -> Visual Settings -> Render Precision
# note: 자세한 내용은 다음 예를 참조하십시오.
# http://dynamobim.org/math-transit/

# group: 호
# note: 2가지 개별 방법을 사용하여 호를 만듭니다. 즉, 한 번은 노드를 사용하고 한 번은 Code Block을 사용합니다. 결과는 명확하게 확인할 수 있도록 시각화됩니다.

# group: 팁
# 형상 노드 강조 표시
# note: 팁: 형상을 그리는 노드를 선택하면 노드에서 만드는 형상이 청록색으로 바뀝니다. 이 코드 블록은 그래프의 축을 그리고 곡선을 따라 점을 그린 다음 곡선 자체를 그립니다. 배경에서 코드 블록이 그리는 곡선을 보려면 코드 블록을 선택하십시오.

# group: 코사인 곡선
# note: 이 예 세트는 노드와 Code Block을 사용하여 코사인 함수를 그래프로 표시하는 방법을 보여줍니다.
# 각 예에서는 일련의 숫자를 일련의 점에 대한 x 값으로 사용하고 x 값에서 y 값을 계산한 다음 코사인 곡선 모양으로 선을 그립니다. 각 그래프 끝에 있는 큰 코드 블록은 그려진 형상이 모두 겹치지 않도록 해당 형상을 화면의 다른 부분으로 이동시킵니다.

# group: 팁
# 렌더 정밀도
# note: Tip: Adjust how precisely the geometry in the background preview is rendered by navigating to Dynamo -> Preferences -> Visual Settings -> Render Precision.  A higher value will make curved surfaces look smoother, but it will take more processing power to draw.

# group: 노드 > 점 리스트에 대한 초기 입력
code_block = CodeBlock { -10..10..#20; }

# group: 노드 > 초기 점 리스트 작성 및 조작
# note: 점의 그리드를 만듭니다.
# 레이싱 동작은
# "외적"입니다
byCoordinates = Point.ByCoordinates(x=code_block, y=code_block, lacing=CrossProduct)
flatten = List.Flatten(list=byCoordinates)
X = Point.X(point=flatten)
Y = Point.Y(point=flatten)

# group: 노드 > 크기
# note: 크기
number_slider = DoubleSlider(5.51, range=0..10 step 0.1)  # graph input

# group: 노드 > 정사각형
number = DoubleInput(2)  # graph input
pow = Math.Pow(number=X, power=number)

# group: 노드 > 정사각형
number_2 = DoubleInput(2)  # graph input
pow_2 = Math.Pow(number=Y, power=number_2)

# group: 노드 > 빈도
# note: 빈도
number_slider_2 = DoubleSlider(1.724, range=0..6 step 0.1)  # graph input

# group: 노드 > 정사각형
number_3 = DoubleInput(2)  # graph input
pow_3 = Math.Pow(number=number_slider_2, power=number_3)

# group: 노드 > 노드를 사용하여 '잔물결' 형상을 만들기 위한 일련의 수학적 계산 및 조작
add = pow + pow_2
add_2 = add + pow_3
sqrt = Math.Sqrt(number=add_2)
# note: Dynamo의 각도는 도 단위로 표시됩니다
radiansToDegrees = Math.RadiansToDegrees(radians=sqrt)
sin = Math.Sin(angle=radiansToDegrees)
div = sin / sqrt
mul = number_slider * div

# group: 노드 > 결과 점 수집 및 최종 렌더링 준비
byCoordinates_2 = Point.ByCoordinates(x=X, y=Y, z=mul)
# note: 초기 점 모음(20x20)에서 점의 그룹 수를 계산합니다.
count = List.Count(list=byCoordinates)

# group: 노드 > 점 모음
# note: 단순 리스트를 행을 기준으로
# 여러 개의 리스트로 나눕니다
chop = List.Chop(list=byCoordinates_2, lengths=count)

# group: 노드 > 곡선 네트워크
# note: 점을 통해 NURBS 곡선을
# 만듭니다
byPoints = NurbsCurve.ByPoints(points=chop)

# group: 노드 > 최종 표면
# note: 표면을 만듭니다
byLoft = Surface.ByLoft(crossSections=byPoints)

# group: Code Block > 점 리스트에 대한 초기 입력
code_block_2 = CodeBlock { -10..10..#20; }

# group: Code Block > 초기 점 리스트 작성 및 조작
byCoordinates_3 = Point.ByCoordinates(x=code_block_2, y=code_block_2, lacing=CrossProduct)
flatten_2 = List.Flatten(list=byCoordinates_3)
Y_2 = Point.Y(point=flatten_2)
X_2 = Point.X(point=flatten_2)

# group: Code Block > 형상을 이동하기 위한 도우미 함수
# note: 형상을 이동합니다
code_block_3 = CodeBlock(x=Y_2) { x+60; }

# group: Code Block > 빈도
number_slider_3 = DoubleSlider(1.724, range=0..5 step 0.1)  # graph input

# group: Code Block > 크기
number_slider_4 = DoubleSlider(5.51, range=0..10 step 0.1)  # graph input

# group: Code Block > Python을 사용하여 '잔물결' 형상을 만들기 위한 일련의 수학적 계산 및 조작
# note: 수학적 방법의 이름은 첫 번째 예에서 사용되는 Dynamo 노드의 이름과 일치합니다.
code_block_4 = CodeBlock(x=X_2, y=Y_2, c=number_slider_3, A=number_slider_4)
# ---------- code_block_4.designscript (6 lines) ----------
sum = Math.Pow(x,2) + Math.Pow(y,2) + Math.Pow(c,2);

num1 = Math.Sqrt(sum);
num2 = Math.Sin( Math.RadiansToDegrees(num1) );

A * num2 / num1;
# ----------------------------------------

# group: Code Block > 결과 점 수집 및 최종 렌더링 준비
byCoordinates_4 = Point.ByCoordinates(x=code_block_3, y=X_2, z=code_block_4.out3)
count_2 = List.Count(list=byCoordinates_3)

# group: Code Block > 점 모음
chop_2 = List.Chop(list=byCoordinates_4, lengths=count_2)

# group: Code Block > 곡선 네트워크
byPoints_2 = NurbsCurve.ByPoints(points=chop_2)

# group: Code Block > 최종 표면
byLoft_2 = Surface.ByLoft(crossSections=byPoints_2)

# group: Python > 점 리스트에 대한 초기 입력
code_block_5 = CodeBlock { -10..10..#20; }

# group: Python > 초기 점 리스트 작성 및 조작
byCoordinates_5 = Point.ByCoordinates(x=code_block_5, y=code_block_5, lacing=CrossProduct)
flatten_3 = List.Flatten(list=byCoordinates_5)
X_3 = Point.X(point=flatten_3)
Y_3 = Point.Y(point=flatten_3)

# group: Python > 형상을 이동하기 위한 도우미 함수
# note: 형상을 이동합니다
code_block_6 = CodeBlock(x=X_3) { x+30; }

# group: Python > 크기
number_slider_5 = DoubleSlider(5.51, range=0..10 step 0.1)  # graph input

# group: Python > 빈도
number_slider_6 = DoubleSlider(1.724, range=0..5 step 0.1)  # graph input

# group: Python > Python을 사용하여 '잔물결' 형상을 만들기 위한 일련의 수학적 계산 및 조작
python_script = Python(Amplitude=number_slider_5, X=X_3, Y=Y_3, Frequency=number_slider_6)  # CPython3
# ---------- python_script.python (27 lines) ----------
import clr
clr.AddReference('ProtoGeometry')
from Autodesk.DesignScript.Geometry import *

import math

# The inputs to this node will be stored as a list in the IN variable.
amp = IN[0]   # single value
x = IN[1]     # list
y = IN[2]     # list (expect same length as x)
c = IN[3]     # single value

# Declare an empty array of z-values
z = []

# Solve the equation for each x and y value
for index in range(len(x)):
	sum = math.pow(x[index],2) + math.pow(y[index],2) + math.pow(c,2)
	num1 = math.sqrt(sum)
	num2 = math.sin(num1)
	zVal = amp * num2 / num1
	
	# Append the answer to the list of z values
	z.append(zVal)

# Assign the z-values to the OUT variable
OUT = z
# ----------------------------------------

# group: Python > 결과 점 수집 및 최종 렌더링 준비
byCoordinates_6 = Point.ByCoordinates(x=code_block_6, y=Y_3, z=python_script)
count_3 = List.Count(list=byCoordinates_5)

# group: Python > 점 모음
chop_3 = List.Chop(list=byCoordinates_6, lengths=count_3)

# group: Python > 곡선 네트워크
byPoints_3 = NurbsCurve.ByPoints(points=chop_3)

# group: Python > 최종 표면
byLoft_3 = Surface.ByLoft(crossSections=byPoints_3)

# group: Code Block을 사용한 코사인 곡선 > 입력
# note: 기준 좌표점
code_block_7 = CodeBlock { 25; 20; }
# note: X 값의 시리즈
code_block_8 = CodeBlock { 0..10..#20; }
# note: 크기
number_slider_7 = DoubleSlider(3, range=0..10 step 0.1)  # graph input
# note: 빈도
number_slider_8 = DoubleSlider(36, range=0..100 step 0.1)  # graph input

# group: Code Block을 사용한 코사인 곡선 > 코사인 곡선 함수
# 지정된 주파수와 각도에 대한 코사인 값을 구한 다음 진폭을 곱합니다.
code_block_9 = CodeBlock(amplitude=number_slider_7, frequency=number_slider_8, angle=code_block_8) { amplitude * Math.Cos(frequency * angle); }

# group: Code Block을 사용한 코사인 곡선 > 중간 연산
byCoordinates_7 = Point.ByCoordinates(x=code_block_7.out0, y=code_block_7.out1)
byCoordinates_8 = Point.ByCoordinates(x=code_block_8, y=code_block_9)

# group: Code Block을 사용한 코사인 곡선 > 코사인 곡선 작성 및 시각화
code_block_10 = CodeBlock(base=byCoordinates_7, pts=byCoordinates_8)
# ---------- code_block_10.designscript (14 lines) ----------
// Make axes from base point
dimension = 10;
top = Point.ByCoordinates(base.X, base.Y + dimension/2);
bottom = Point.ByCoordinates(base.X, base.Y - dimension/2);
right = Point.ByCoordinates(base.X + 10, base.Y);
Line.ByStartPointEndPoint(bottom, top);
Line.ByStartPointEndPoint(base, right);

// Move function results to base point
vec = base.AsVector();
newPts = pts.Add(vec);

// Draw a line through the points
NurbsCurve.ByPoints(newPts);
# ----------------------------------------

# group: 노드를 사용한 코사인 곡선 > 입력
# note: 기준점 x,y 좌표
code_block_11 = CodeBlock { -5; 20; }
# note: X 값의 시리즈
code_block_12 = CodeBlock { 0..10..#20; }
# note: 빈도
number_slider_9 = DoubleSlider(36, range=0..100 step 0.1)  # graph input

# group: 노드를 사용한 코사인 곡선 > 진폭 제어
# note: 크기
number_slider_10 = DoubleSlider(3, range=0..10 step 0.1)  # graph input

# group: 노드를 사용한 코사인 곡선
mul_2 = number_slider_9 * code_block_12

# group: 노드를 사용한 코사인 곡선 > Math.Cos 함수
# 각 초기 숫자에 대한 코사인 값을 구합니다.
cos = Math.Cos(angle=mul_2)

# group (continued): 노드를 사용한 코사인 곡선
mul_3 = number_slider_10 * cos

# group: 노드를 사용한 코사인 곡선 > 중간 연산
byCoordinates_9 = Point.ByCoordinates(x=code_block_11.out0, y=code_block_11.out1)
# note: 팁: 형상을 만드는 모든 노드에 대해 미리보기 기능을 켜거나 끌 수 있습니다. 마우스 오른쪽 버튼을 클릭하고 "미리보기"를 선택하거나 선택 취소하십시오
byCoordinates_10 = Point.ByCoordinates(x=code_block_12, y=mul_3)

# group: 노드를 사용한 코사인 곡선 > 코사인 곡선 작성 및 시각화
code_block_13 = CodeBlock(base=byCoordinates_9, pts=byCoordinates_10)  # same code as code_block_10

# group: 노드를 사용한 호 > 입력
# 다음 중 필요한 입력을 만듭니다.
# 1. 중심점
# 2. 반지름
# 3. 시작 각도
# 4. 끝 각도
# 5. 법선(ZAxsis)
code_block_14 = CodeBlock { 0; 35; }
byCoordinates_11 = Point.ByCoordinates(x=code_block_14.out0, y=code_block_14.out1)
code_block_15 = CodeBlock { 5; 0; }
# note: 호의 길이를 변경하려면 슬라이더를 이동합니다.
number_slider_11 = DoubleSlider(247.821, range=0..360 step 0.1)  # graph input
ZAxis = Vector.ZAxis()

# group: 노드를 사용한 호 > 중심점, 반지름 및 각도로 호 만들기
# note: 노드 또는 코드 볼록에서는 라디안 각도를 사용합니다.
byCenterPointRadiusAngle = Arc.ByCenterPointRadiusAngle(center=byCoordinates_11, radius=code_block_15.out0, startAngle=code_block_15.out1, endAngle=number_slider_11, normal=ZAxis)

# group: 노드를 사용한 호 > 출력 시각화
endPoint = Curve.EndPoint(curve=byCenterPointRadiusAngle)
byStartPointEndPoint = Line.ByStartPointEndPoint(startPoint=endPoint, endPoint=byCoordinates_11)
startPoint = Curve.StartPoint(curve=byCenterPointRadiusAngle)
byStartPointEndPoint_2 = Line.ByStartPointEndPoint(startPoint=startPoint, endPoint=byCoordinates_11)

# group: 노드를 사용한 작업 > -
code_block_16 = CodeBlock { 5; 2; }
sub = code_block_16.out0 - code_block_16.out1
watch = Watch(sub)

# group: Code Block을 사용한 연산 > -
code_block_17 = CodeBlock { 5-2; }
watch_2 = Watch(code_block_17)

# group: Code Block을 사용한 연산 > %
code_block_18 = CodeBlock { 5%2; }
watch_3 = Watch(code_block_18)

# group: 노드를 사용한 작업 > %
code_block_19 = CodeBlock { 5; 2; }
mod = code_block_19.out0 % code_block_19.out1
watch_4 = Watch(mod)

# group: Code Block을 사용한 연산 > <=
code_block_20 = CodeBlock { 5<=2; }
watch_5 = Watch(code_block_20)

# group: Code Block을 사용한 연산 > >
code_block_21 = CodeBlock { 5>2; }
watch_6 = Watch(code_block_21)

# group: 노드를 사용한 작업 > <=
code_block_22 = CodeBlock { 5; 2; }
le = code_block_22.out0 <= code_block_22.out1
watch_7 = Watch(le)

# group: 노드를 사용한 작업 > >
code_block_23 = CodeBlock { 5; 2; }
gt = code_block_23.out0 > code_block_23.out1
watch_8 = Watch(gt)

# group: Code Block을 사용한 호 > 입력
# 다음 중 필요한 입력을 만듭니다.
# 1. 중심점
# 2. 끝 각도
code_block_24 = CodeBlock { 15; 35; }
byCoordinates_12 = Point.ByCoordinates(x=code_block_24.out0, y=code_block_24.out1)
number_slider_12 = DoubleSlider(126.947, range=0..360 step 0.1)  # graph input

# group: Code Block을 사용한 호 > 중심점, 반지름 및 각도로 호 만들기
code_block_25 = CodeBlock(center=byCoordinates_12, endAngle=number_slider_12) { Arc.ByCenterPointRadiusAngle(center,5,0,endAngle,Vector.ZAxis()); }

# group: Code Block을 사용한 호 > 출력 시각화
startPoint_2 = Curve.StartPoint(curve=code_block_25)
byStartPointEndPoint_3 = Line.ByStartPointEndPoint(startPoint=startPoint_2, endPoint=byCoordinates_12)
endPoint_2 = Curve.EndPoint(curve=code_block_25)
byStartPointEndPoint_4 = Line.ByStartPointEndPoint(startPoint=endPoint_2, endPoint=byCoordinates_12)

# group: 노드를 사용한 반올림 > 입력
code_block_26 = CodeBlock { 3.14159; }
code_block_27 = CodeBlock { 3; }

# group: 노드를 사용한 반올림 > 반내림
floor = Math.Floor(number=code_block_26)
watch_9 = Watch(floor)

# group: 노드를 사용한 반올림 > 반올림
ceiling = Math.Ceiling(number=code_block_26)
watch_10 = Watch(ceiling)

# group: 노드를 사용한 반올림 > 반올림 또는 반내림
# 가장 근사한 값
round = Math.Round(number=code_block_26)
watch_11 = Watch(round)

# group: 노드를 사용한 반올림 > 지정된 자릿수로 반올림
round_2 = Math.Round(number=code_block_26, digits=code_block_27)
watch_12 = Watch(round_2)

# group: Code Block을 사용한 반올림 > 입력
code_block_28 = CodeBlock { 3.14159; }

# group: Code Block을 사용한 반올림 > 반내림
code_block_29 = CodeBlock(num=code_block_28) { Math.Floor(num); }
watch_13 = Watch(code_block_29)

# group: Code Block을 사용한 반올림 > 반올림
code_block_30 = CodeBlock(num=code_block_28) { Math.Ceiling(num); }
watch_14 = Watch(code_block_30)

# group: Code Block을 사용한 반올림 > 반올림 또는 반내림
# 가장 근사한 값
code_block_31 = CodeBlock(num=code_block_28) { Math.Round(num); }
watch_15 = Watch(code_block_31)

# group: Code Block을 사용한 반올림 > 지정된 자릿수로 반올림
# 설명 <그룹 설명을 편집하려면 여기를 두 번 클릭하십시오.>
code_block_32 = CodeBlock(num=code_block_28) { Math.Round(num,3); }
watch_16 = Watch(code_block_32)

# group: Code Block을 사용한 연산 > ==(equals)
code_block_33 = CodeBlock { true == false; }
watch_17 = Watch(code_block_33)

# group: Code Block을 사용한 연산 > Not
code_block_34 = CodeBlock { !true; }
watch_18 = Watch(code_block_34)

# group: Code Block을 사용한 연산 > &&(and)
code_block_35 = CodeBlock { true && false; }
watch_19 = Watch(code_block_35)

# group: Code Block을 사용한 연산 > ||(or)
code_block_36 = CodeBlock { true || false; }
watch_20 = Watch(code_block_36)

# group: 노드를 사용한 작업 > ==(equals)
boolean = BoolSelector(true)  # graph input
boolean_2 = BoolSelector(false)  # graph input
eq = boolean == boolean_2
watch_21 = Watch(eq)

# group: 노드를 사용한 작업 > ||(or)
boolean_3 = BoolSelector(true)  # graph input
boolean_4 = BoolSelector(false)  # graph input
or_ = boolean_3 || boolean_4
watch_22 = Watch(or_)

# group: 노드를 사용한 작업 > &&(and)
boolean_5 = BoolSelector(true)  # graph input
boolean_6 = BoolSelector(false)  # graph input
and_ = boolean_5 && boolean_6
watch_23 = Watch(and_)

# group: 노드를 사용한 작업 > Not
boolean_7 = BoolSelector(true)  # graph input
not_ = Not(x=boolean_7)
watch_24 = Watch(not_)
