# Dynamo graph Core_PassingFunctions.dyn (Dynamo 3.1.0.3411)
# author: Dynamo Team
# Dynamo에서 함수를 전달하는 방법을 보여줍니다.

# group: 정보
# note: 전달 함수
# Dynamo는 기능 언어로, 동작이 객체와 동일한 방식으로 처리됩니다. Dynamo 대부분의 노드는 함수로 전환하고 데이터 세트에 대해 매우 정밀한 방식으로 사용할 수 있습니다.
# 함수를 만들고 함수를 전달하는 것은 "20분간 달리기" 명령을 내린 다음, 나중에 명령을 받는 사람을 지정하는 것과 같습니다.
# 이 예에서는 원의 그리드가 복잡한 구조로 표현됩니다. 원의 세트를 선택하는 명령이 직접 사용되며, 그런 다음 다른 결과를 얻기 위해 명령이 데이터의 레벨을 낮추는 함수로 대신 전달됩니다.

# group: 초기 입력
# 5x8 점 행렬을 만듭니다.
code_block = CodeBlock { 0..#8..4; }
code_block_2 = CodeBlock { 0..#5..4; }
byCoordinates = Point.ByCoordinates(x=code_block, y=code_block_2, lacing=CrossProduct)

# group: 원 행렬 그리기
# note: 이 점 리스트는 계층 구조로 구성되는 리스트의 리스트입니다. 그리드는 X 방향의 점 8개와 Y 방향의 점 5개로 작성되었습니다. 이 리스트는 항목 5개의 리스트 8개 또는 점 열의 리스트를 나타냅니다.
watch = Watch(byCoordinates)
code_block_3 = CodeBlock { 1.5; }
# note: 각 점 주위에 원을 그립니다.
byCenterPointRadius = Circle.ByCenterPointRadius(centerPoint=watch, radius=code_block_3)

# group: 두 번째 및 세 번째 리스트 선택
# 함수 전달
code_block_4 = CodeBlock { 1..2; }
# note: 원의 내포된 리스트에서 항목 {1,2}가 선택됩니다. Dynamo 노드는 항상 "바깥쪽에서 안쪽으로" 또는 가장 높은 레벨에서 가장 낮은 레벨로 리스트에 적용됩니다.
# 리스트에서 항목 1과 2를 선택하면 원래의 내포된 리스트 구조에서 리스트 #1과 리스트 #2가 반환됩니다.
getItemAtIndex = List.GetItemAtIndex(list=byCenterPointRadius, index=code_block_4)

# group: 위로 돌출
# 결과 원통
# note: 선택된 데이터는 여전히 매핑을 통해 선택하기 전과 동일한 구조에 존재합니다.
watch_2 = Watch(getItemAtIndex)
code_block_5 = CodeBlock { 3; }
# note: 이 원 리스트는 위로 돌출됩니다.
extrude = Curve.Extrude(curve=watch_2, distance=code_block_5)

# group: 각 리스트에서 두 번째 및 세 번째 항목 선택
# 함수 전달
code_block_6 = CodeBlock { 1..2; }
# note: List@Level 기능을 통해 노드의 출력에서 처음 두 리스트 대신 List.GetItemAtIndex의 입력 포트에서 L2를 선택하여 각 리스트에서 #1 및 #2 항목을 가져옵니다.
# 이 기능은 Dynamo의 이전 버전에서 입력 리스트의 내부 레벨에 액세스하는 데 사용된 List.Map의 문제를 해결합니다.
getItemAtIndex_2 = List.GetItemAtIndex(list=byCenterPointRadius@L2, index=code_block_6)

# group: 아래로 돌출
# 결과 원통
watch_3 = Watch(getItemAtIndex_2)
code_block_7 = CodeBlock { -3; }
# note: 이 원 리스트는 아래로 돌출됩니다.
extrude_2 = Curve.Extrude(curve=watch_3, distance=code_block_7)
