# Dynamo graph Core_Python.dyn (Dynamo 4.1.0.2940)
# author: Dynamo Team
# Dynamo 내에서 Python 노드 사용

# group: 정보
# note: PYTHON
# Dynamo에서는 두 가지 Python 노드 중 하나를 통해 CPython을 지원합니다(여기 표시되지 않은 두 번째 Python 노드 유형은 외부 파일에서 실행될 스크립트를 읽을 수 있음).
# Python 노드를 두 번 클릭하면 노드에 포함된 스크립트를 볼 수 있습니다.
# 입력은 IN 배열에 포함됩니다. 출력은 OUT 변수에 지정해야 합니다. 출력은 단일 값 또는 배열 자체입니다.

# group: Python 노드를 사용하여 리스트에 부호 조작 적용
# note: 이 예에서는 리스트의 모든 항목을 더하거나 뺍니다. 입력은 숫자(숫자의 부호에 따라 덧셈을 사용할 것인지 뺄셈을 사용할 것인지 결정됨) 및 숫자의 리스트입니다.

# group: 양수, 0 또는 음수 선택
# 설명 <그룹 설명을 편집하려면 여기를 두 번 클릭하십시오.>
# note: 연산의 부호를 선택합니다.
#     숫자 < 0      각 항목을 뺍니다.
#     숫자 = 0      0
#     숫자 > 0      각 항목을 더합니다
integer_slider = IntegerSlider(1, range=-1..2 step 1)

# group: 입력 리스트 만들기
# note: 리스트 만들기
code_block = CodeBlock { 0..10; }
watch = Watch(code_block)

# group: Python
# 부호 조작을 적용합니다.
# note: OUT의 출력은 배열입니다. 이 배열의 첫 번째 항목은 단일 값이고 두 번째 항목은 값의 리스트입니다. 이 데이터 구조는 Python 정의 자체에 지정되었습니다. 배열을 지정하면 임의의 개수의 출력을 Dynamo 그래프에 보낼 수 있습니다.
python_script = Python(Sign=integer_slider, List=watch)  # PythonNet3
# ---------- python_script.python (31 lines) ----------
# Python script to find add or subtract a series of numbers. 

# Boiler-plate import statments included out-of-the-box
import clr
clr.AddReference('ProtoGeometry')
from Autodesk.DesignScript.Geometry import *

# The inputs to this node will be stored as a list in the IN variable.
sign = IN[0]  # -1 for subtract all, 0 for do nothing, 1 for add all
nums = IN[1]  # List of numbers to subtract or add

partials = [] # Empty array to contain partial sums or differences
result = 0    # Initialize the sum or difference to 0

# Loop through each item and add it or subtract it from the result.
for index in range(len(nums)):
	if sign > 0:
		result = result + nums[index]
		partials.append(result)
	elif sign == 0:
		partials.append(result)
		continue
	else:
		result = result - nums[index]
		partials.append(result)

# Assign the output to the OUT variable
#OUT = results  # Use this to output only the result.
OUT = []
OUT.append(result)
OUT.append(partials)
# ----------------------------------------

# group: 결과 리스트
code_block_2 = CodeBlock { 1; }
getItemAtIndex = List.GetItemAtIndex(list=python_script, index=code_block_2)
# note: 일련의 부분적인 결과.
watch_2 = Watch(getItemAtIndex)

# group: 결과 합계
code_block_3 = CodeBlock { 0; }
getItemAtIndex_2 = List.GetItemAtIndex(list=python_script, index=code_block_3)
# note: 전체 결과.
watch_3 = Watch(getItemAtIndex_2)

# group: Python 형상 작성
# note: 이 Python 예에는 입력이 없습니다. 이 예에서는 Dynamo의 프로토지오메트리 라이브러리를 사용하여 형상을 만드는 방법을 보여줍니다. Python 노드에서는 눈에 보이는 형상을 만들기 때문에 다른 노드처럼 Python 노드를 선택하면 형상이 하이라이트됩니다.
python_script_2 = Python()  # PythonNet3
# ---------- python_script_2.python (24 lines) ----------
import clr
clr.AddReference('ProtoGeometry')
from Autodesk.DesignScript.Geometry import *
#The inputs to this node will be stored as a list in the IN variable.
dataEnteringNode = IN

p1 = Point.ByCoordinates(0, 0, 0);
p2 = Point.ByCoordinates(-10, -10, -10);

l = Line.ByStartPointEndPoint(p1, p2);

pts = [
	Point.ByCoordinates(0, 0, 0),
	Point.ByCoordinates(10, 10, 0),
	Point.ByCoordinates(20, 0, 0),
	Point.ByCoordinates(30, 10, 0),
	Point.ByCoordinates(40, 0, 0) ]
	
spline = NurbsCurve.ByPoints(pts)

surf = spline.Extrude(Vector.ByCoordinates(0, 0, 1), 10)

#Assign your output to the OUT variable
OUT = [l, spline, surf]
# ----------------------------------------

# group: 결과 출력 검토
# note: 팁: 리스트의 특정 항목에 액세스하려면
# 코드 블록을 사용하십시오.
code_block_4 = CodeBlock(output=python_script_2) { output[0]; output[1]; output[2]; }
watch_4 = Watch(code_block_4.out2)
watch_5 = Watch(code_block_4.out0)
watch_6 = Watch(code_block_4.out1)
