# Dynamo graph Core_RangeSyntax.dyn (Dynamo 3.0.0.6964)
# author: Dynamo Team
# 이 그래프는 간격이 균등한 숫자 또는 문자를 연속적으로 생성하는 여러 가지 방법을 제공합니다.

# group: 정보
# note: 범위 구문
# 숫자 또는 문자의 시퀀스로 리스트를 만드는 방법에는 여러 가지가 있습니다.
# 시퀀스는 요소 배열, 반복을 만들거나 다양한 함수 및 방정식을 준비할 때 유용할 수 있습니다.

# group: Code Block 사용
# note: start..end..step
# 0에서 10까지, 2단계
# 이 메서드는 Range 노드를 사용하는 것과 같습니다.
code_block = CodeBlock { 0..10..2; }
watch = Watch(code_block)
# note: start..en
# 지정하지 않으면 단계 값은 1로 가정합니다.
# 이 메서드는 Range 노드를 사용하는 것과 같습니다.
# note: Code Block 노드에서 범위 구문을 사용합니다. 일련의 숫자(또는 문자)를 생성하는 방법에는 다음과 같이 여러 가지가 있습니다.
#         start..end..step
#         start..end..#amount
#         start..#amount..interval
# start = 시리즈의 시작 숫자/문자
# end = 시리즈의 끝 숫자/문자
# step = 연속된 두 숫자/문자 사이의 차이
# amount = 시리즈에 포함된 숫자/문자 수
code_block_2 = CodeBlock { 0..10; }
watch_2 = Watch(code_block_2)
# note: start..end..#amount
# 3단계로 0에서 10까지
code_block_3 = CodeBlock { 0..10..#3; }
watch_3 = Watch(code_block_3)
# note: start..#amount..interval
# 10단계(0부터 시작), 각 단계는 3입니다.
# 이 메서드는 Sequence 노드를 사용하는 것과 같습니다.
code_block_4 = CodeBlock { 0..#10..3; }
watch_4 = Watch(code_block_4)

# group: 동적 입력과 함께 Code Block 사용
integer_slider = IntegerSlider(7, range=0..10 step 1)
# note: 값을 변수로 대체하고 슬라이더를 사용하여 리스트의 길이를 동적으로 제어합니다.
code_block_5 = CodeBlock(howMany=integer_slider) { 0..#howMany..3; }
watch_5 = Watch(code_block_5)

# group: Sequence 사용
number = DoubleInput(0)
number_slider = DoubleSlider(8, range=0..10 step 0.1)
number_2 = DoubleInput(2)
# note: 리스트의 항목 수와 각 단계의 길이를 알고 있는 경우 Sequence 노드를 사용합니다. 리스트의 마지막 결과는 미리 정의되어 있지 않고 다른 입력을 기반으로 계산됩니다.
# 예: 8대의 차량을 주차할 수 있는 공간을 설계할 때 각 주차 공간의 너비를 알고 있는 경우. 모든 주차 공간의 전체 폭은 개별 폭과 공간 수에 따라 달라집니다.
sequence = Sequence(start=number, amount=number_slider, step=number_2, lacing=Longest)
watch_6 = Watch(sequence)

# group: Range 사용
number_3 = DoubleInput(0)
number_4 = DoubleInput(10)
number_slider_2 = DoubleSlider(1.75, range=0..10 step 0.1)
# note: 시퀀스의 시작과 끝을 알고 있는 경우 Range 노드를 사용합니다. 결과 리스트의 항목 수는 미리 정의되어 있지 않고 다른 입력을 기반으로 계산됩니다.
# step 값이 'end'를 초과할 때 step을 추가하면 리스트의 마지막 항목이 'end' 입력과 일치하지 않을 수 있습니다.
# 세트 'start'와 'end' 사이의 step 값을 늘리면 항목이 더 줄어들 수 있습니다. 반대로 step을 줄이면 리스트의 길이가 늘어날 수 있습니다.
range = Range(start=number_3, end=number_4, step=number_slider_2, lacing=Longest)
watch_7 = Watch(range)

# group: Range 사용 - 문자열 포함
string = StringInput("A")
string_2 = StringInput("P")
code_block_6 = CodeBlock { 1; }
# note: Range 노드는 문자 시퀀스를 생성하는 데도 사용할 수 있습니다!
range_2 = Range(start=string, end=string_2, step=code_block_6, lacing=Longest)
watch_8 = Watch(range_2)

# group: Sequence 사용 - 문자열 포함
string_3 = StringInput("A")
code_block_7 = CodeBlock { 20; }
# note: Sequence 노드를 사용하여 일련의 문자를 알파벳 순서로 생성합니다.
sequence_2 = Sequence(start=string_3, amount=code_block_7)
watch_9 = Watch(sequence_2)

# note: 값 시퀀스를 사용하여 일련의 점을 만듭니다.
byCoordinates = Point.ByCoordinates(x=code_block_5)
