# Dynamo graph Core_Strings.dyn (Dynamo 3.4.1.7055)
# author: Dynamo Team
# 이 그래프는 문자열에 대해 수행할 수 있는 작업을 보여줍니다.

# group: 정보
# note: 문자열
# 이 예 세트는 문자열로 수행할 수 있는 몇 가지 작업을 보여 줍니다. 문자열 연산을 위한 더 많은 노드는 노드 라이브러리의 'String' 카테고리 아래에서 찾을 수 있습니다.

byCoordinates = Point.ByCoordinates()
code_block = CodeBlock { 5; }
# note: 객체 작성 - 원
byCenterPointRadius = Circle.ByCenterPointRadius(centerPoint=byCoordinates, radius=code_block)

# group: 객체를 문자열로 변환
# note: 객체를 객체 자체의 문자열 설명으로 변환합니다.
string_from_object = FromObject(obj=byCenterPointRadius)

watch = Watch(string_from_object)

# group: 구분 기호를 사용하여 문자열 분할
code_block_2 = CodeBlock { "("; ")"; " "; "="; ","; }
# note: 하나 이상의 구분 기호 문자를 지정하여 문자열을 여러 부분으로 나눕니다. 각 구분 기호는 하나 이상의 문자일 수 있습니다.
split = String.Split(string=watch, separator0=code_block_2.out0, separator1=code_block_2.out1, separator2=code_block_2.out2, separator3=code_block_2.out3, separator4=code_block_2.out4)

watch_2 = Watch(split)

# group: 문자열에 하위 문자열이 포함되어 있는지 확인
code_block_3 = CodeBlock { "."; }
# note: 문자열에 다른 문자열이 포함되어 있는지 확인합니다.
contains = String.Contains(string=watch_2, searchFor=code_block_3)

watch_3 = Watch(contains)

# group: 문자열 작성
# note: Code Block을 사용하여 문자열 작성- "" 표시로 문자열 값을 구분합니다.
code_block_4 = CodeBlock { "Few things are harder to put up with than a good example."; }

# group: 대문자로 변경
string = StringInput(" - Mark Twain")
# note: 문자열의 대소문자를 변경합니다
toUpper = String.ToUpper(string=string)
watch_4 = Watch(toUpper)

# group: 연결
# note: 두 문자열을 연결하여 "concatenating"("concat")이라고 하는 문자열을 만듭니다.
concat = String.Concat(string0=code_block_4, string1=watch_4)

watch_5 = Watch(concat)

# group: 문자열에서 문자 바꾸기
code_block_5 = CodeBlock { "put"; }
code_block_6 = CodeBlock { "come"; }
# note: 하위 문자열의 모든 항목을 대체 문자열로 대체합니다.
replace = String.Replace(string=watch_5, searchFor=code_block_5, replaceWith=code_block_6)

watch_6 = Watch(replace)

# group: 문자열에서 하위 문자열 찾기
code_block_7 = CodeBlock { " to"; }
# note: 문자열에서 특정 하위 문자열이 발생하는 위치를 찾습니다. 결과는 하위 문자열이 시작되는 색인입니다.
indexOf = String.IndexOf(string=watch_6, searchFor=code_block_7)
watch_7 = Watch(indexOf)

# group: 문자열 길이
# note: 문자열의 총 문자 수를 셉니다.
length = String.Length(string=watch_6)
watch_8 = Watch(length)

# note: 문자열의 전체 길이에서 문자열의 첫 번째 부분을 뺍니다.
sub = watch_8 - watch_7

# group: 문자 제거
# note: 문자열에서 지정된 개수의 문자를 제거합니다.
remove = String.Remove(string=watch_6, startIndex=watch_7, count=sub)

# group: 발생 횟수
watch_9 = Watch(remove)
code_block_8 = CodeBlock { "ar"; }
# note: 문자열 내에서 하위 문자열이 발생하는 횟수를 계산합니다.
countOccurrences = String.CountOccurrences(string=watch_9, searchFor=code_block_8)
watch_10 = Watch(countOccurrences)

# group: 문자열 작성
# note: If the string includes a " character, use an escape character \ before " to treat it as a part of the string and not the end of the string.
code_block_9 = CodeBlock { "There is no \"I\" in Team"; }
watch_11 = Watch(code_block_9)

숫자_범위 = CodeBlock { 2..101; }

# group: '덧셈'을 사용하여 문자열 연결
code_block_10 = CodeBlock { " Dalmatians"; }
# note: '덧셈' 연산은 자동으로 숫자를 문자열로 변환하고 연결을 수행합니다.
add = 숫자_범위 + code_block_10
watch_12 = Watch(add)

# group: 객체를 문자열로 변환
# note: 어떤 경우에는 먼저 객체를 문자열로 변환해야 합니다.
string_from_object_2 = FromObject(object=숫자_범위)
watch_13 = Watch(string_from_object_2)
type = Object.Type(object=string_from_object_2)
watch_14 = Watch(type)

# group: 문자열을 숫자로 변환
code_block_11 = CodeBlock { "101 Dalmatians"; }
code_block_12 = CodeBlock { " "; }
# note: 공백을 구분 기호로 사용하여 문자열을 단어로 분할합니다.
split_2 = String.Split(string=code_block_11, separator0=code_block_12)
# note: 리스트에서 첫 번째 항목 가져오기
firstItem = List.FirstItem(list=split_2)
# note: 문자열을 숫자로 변환
toNumber = String.ToNumber(string=firstItem)
watch_15 = Watch(toNumber)
type_2 = Object.Type(object=toNumber)
watch_16 = Watch(type_2)

# group: 문자열을 숫자로 변환
# note: 부울 리스트를 필터의 마스크로 사용하여 리스트의 모든 숫자를 가져옵니다.
filterByBoolMask = List.FilterByBoolMask(list=watch_2, mask=contains)
# note: 문자열을 숫자로 변환
toNumber_2 = String.ToNumber(string=filterByBoolMask.in)

watch_17 = Watch(filterByBoolMask.in)
