# Dynamo graph Geometry_Curves.dyn (Dynamo 3.1.0.3411)
# author: Dynamo Team
# 기본 곡선 원형(선, Polycurve, 열린 및 닫힌 NURBS 곡선)을 만드는 방법을 보여주는 샘플 그래프입니다.

# group: 정보
# note: 이 그래프는 선, PolyCurve, 열린 닫힌 Nurbs 곡선과 같은 기본 곡선 원형을 만드는 방법을 보여 줍니다.

# group: 초기 입력
number = DoubleInput(5)
number_2 = DoubleInput(10)
number_3 = DoubleInput(15)

# group: 초기 4개의 점
byCoordinates = Point.ByCoordinates()
byCoordinates_2 = Point.ByCoordinates(y=number)
byCoordinates_3 = Point.ByCoordinates(x=number_2, y=number_2)
byCoordinates_4 = Point.ByCoordinates(x=number_3)

# group: 4개의 점 리스트
create = List.Create(item0=byCoordinates, item1=byCoordinates_2, item2=byCoordinates_3, item3=byCoordinates_4)

# group: Nurbs 곡선
# note: 4개의 점으로 Nurbs 곡선 만들기
byPoints = NurbsCurve.ByPoints(points=create)

# group: 선
# note: 두 점에 의한 단일 직선
byStartPointEndPoint = Line.ByStartPointEndPoint(startPoint=byCoordinates, endPoint=byCoordinates_2)

length = Curve.Length(curve=byStartPointEndPoint)

# group: Nurbs 곡선 - 닫힘
boolean = BoolSelector(true)
# note: 경계 점 내부에 닫힌 Nurbs 곡선 만들기
byControlPoints = NurbsCurve.ByControlPoints(points=create, closeCurve=boolean)

# group: PolyCurve
# 설명 <그룹 설명을 편집하려면 여기를 두 번 클릭하십시오.>
# note: 점 세트를 통과하는 직선 polycurve 만들기
# note: 새 참고
byPoints_2 = PolyCurve.ByPoints(points=create)

# group: 작업 및 조회
code_block = CodeBlock { 0..1..#20; }
# note: 곡선, Polycurve(곡선 모음), Nurbs 및 선은 모두 "곡선"에서 파생되므로 모든 곡선은 "동작" 및 "쿼리"를 수행할 수 있습니다
pointAtParameter = Curve.PointAtParameter(curve=byPoints_2, param=code_block)
