# Dynamo graph Geometry_Points.dyn (Dynamo 3.1.0.3411)
# author: Dynamo Team
# 점 배열 만들기

# group: 초기 입력
number_slider = DoubleSlider(6.4, range=0..10 step 0.1)

# group: 단일 점
# note: 기본 형상 요소에는 숫자 입력에 대한 기본값이 있습니다. 노드 입력 포트 위에 마우스 커서를 놓으면 기본값을 확인할 수 있습니다.
byCoordinates = Point.ByCoordinates(z=number_slider)

# group: 결과 미리보기
# note: "실행"을 누르거나 '자동으로 실행'을 활성화한 상태에서 형상 도면요소를 배경 미리보기, Watch 3D 또는 Watch 노드의 데이터로 봅니다. 노드를 선택하면 요소가 베경에서 하이라이트됩니다.
watch_3d = Watch3D(byCoordinates)

# group: 초기 입력
number = DoubleInput(0)
number_2 = DoubleInput(10)
number_3 = DoubleInput(1)

# group: 숫자 범위
# note: 형상의 배열은 시퀀스, 범위 및 리스트를 사용하여 만들 수 있습니다
range = Range(start=number, end=number_2, step=number_3, lacing=Longest)

# group: 점 행렬
# note: 범위를 점 x, y 및 z 포트로 전달한 다음 노드의 오른쪽 클릭 메뉴에서 레이싱 특성을 변경하여 1차원, 2차원, 3차원 배열을 만듭니다. 외적 레이싱 옵션을 선택할 때 결과를 관찰합니다.
byCoordinates_2 = Point.ByCoordinates(x=range, y=range, lacing=CrossProduct)

watch = Watch(byCoordinates)

# group: 점을 벡터로 변환
# 설명 <그룹 설명을 편집하려면 여기를 두 번 클릭하십시오.>
# note: 일부 요소는 다른 요소로 쉽게 변환할 수 있습니다.
asVector = Point.AsVector(point=watch)

# group: 점을 기준으로 행렬을 벡터로 이동
# note: 파생 요소는 도면요소의 동작 하위 카테고리에서 도구를 사용하여 만들 수 있습니다
add = Point.Add(point=byCoordinates_2, vectorToAdd=asVector)

# group: 점 'Z' 좌표 미리보기
# note: 각 노드 그룹화의 질의 하위 카테고리(물음표 기호 옆)에 있는 노드를 사용하여 형상에서 정보를 추출할 수 있습니다.
Z = Point.Z(point=byCoordinates)
