# Dynamo graph Geometry_Solids.dyn (Dynamo 3.1.0.3411)
# author: Dynamo Team
# 로프트 및 솔리드 조작(덧셈 및 뺄셈)을 사용하여 솔리드 생성을 보여주는 Dynamo 샘플 그래프입니다.

# group: 첫 번째 곡선 그룹에 대한 초기 점
byCoordinates = Point.ByCoordinates()
number = DoubleInput(10)
byCoordinates_2 = Point.ByCoordinates(x=number)
byCoordinates_3 = Point.ByCoordinates(y=number)

# group: 두 번째 곡선 그룹에 대한 추가 점
number_2 = DoubleInput(5)
byCoordinates_4 = Point.ByCoordinates(z=number_2)

# group: 하단 기준의 초기 곡선 만들기
byStartPointEndPoint = Line.ByStartPointEndPoint(startPoint=byCoordinates, endPoint=byCoordinates_2)
byThreePoints = Arc.ByThreePoints(firstPoint=byCoordinates, secondPoint=byCoordinates_4, thirdPoint=byCoordinates_2)

# group: 하단 기준 만들기
create = List.Create(item0=byStartPointEndPoint, item1=byThreePoints)
byJoinedCurves = PolyCurve.ByJoinedCurves(curves=create)

# group: 세 번째 곡선 그룹에 대한 추가 점
number_3 = DoubleInput(15)
byCoordinates_5 = Point.ByCoordinates(x=number_3, y=number_3)

# group: 네 번째 곡선 그룹에 대한 추가 점
number_4 = DoubleInput(5)
number_5 = DoubleInput(10)
byCoordinates_6 = Point.ByCoordinates(x=number_4, y=number_5, z=number_5)

# group: 상단 기준의 초기 곡선 만들기
byStartPointEndPoint_2 = Line.ByStartPointEndPoint(startPoint=byCoordinates_3, endPoint=byCoordinates_5)
byThreePoints_2 = Arc.ByThreePoints(firstPoint=byCoordinates_3, secondPoint=byCoordinates_6, thirdPoint=byCoordinates_5)

# group: 상단 기준 만들기
create_2 = List.Create(item0=byStartPointEndPoint_2, item1=byThreePoints_2)
byJoinedCurves_2 = PolyCurve.ByJoinedCurves(curves=create_2)

# group: 기준 곡선을 리스트로 결합
create_3 = List.Create(item0=byJoinedCurves, item1=byJoinedCurves_2)

# group: 로프트
# note: 대부분 솔리드의 경우 여러 가지 만들기 방법이 있습니다. 이 예에서는 닫힌 프로파일을 기준으로 보여주지만 polysurface는 스티치할 수 있으며 (표면, 직육면체, 원추 등) 많은 원형을 사용할 수 있습니다
byLoft = Solid.ByLoft(crossSections=create_3)

# group: 체적
# note: 로프트의 체적을 확인하여 닫힌 솔리드 형상임을 확인할 수 있습니다.
volume = Solid.Volume(solid=byLoft)

# group: 추가 로프트 형상에 대한 추가 점
number_6 = DoubleInput(-2)
number_7 = DoubleInput(5)
byCoordinates_7 = Point.ByCoordinates(x=number_6, y=number_7)

# group: 점을 리스트로 결합
create_4 = List.Create(item0=byCoordinates, item1=byCoordinates_7, item2=byCoordinates_3)

# group: 추가 기준 곡선 작성
# 설명 <그룹 설명을 편집하려면 여기를 두 번 클릭하십시오.>
# note: 이번에는 점 그룹에서 NURBS 곡선을 만듭니다.
byPoints = NurbsCurve.ByPoints(points=create_4)

# group: 로프트 +
# note: 팁: 요소가 표시되지 않도록 하려면 노드 오른쪽 클릭 메뉴에서 "미리보기"를 끄십시오
byLoft_2 = Solid.ByLoft(crossSections=create_3, guideCurves=byPoints)

# group: 형상 +
code_block = CodeBlock { Vector.ByCoordinates(-20,0,0); }
# note: 형상을 이동하여 출력 시각화
translate = Geometry.Translate(geometry=byLoft_2, direction=code_block)

# group: 솔리드 형상을 자를 '재료' 준비
# note: 두께
code_block_2 = CodeBlock { 0; }
# note: 팁: 요소가 표시되지 않도록 하려면 노드 오른쪽 클릭 메뉴에서 "미리보기"를 끄십시오
thinShell = Solid.ThinShell(solid=byLoft, internalFaceThickness=code_block_2)
code_block_3 = CodeBlock { Vector.ByCoordinates(20,0,0); }
# note: 형상을 X 방향으로 20단위 이동
translate_2 = Geometry.Translate(geometry=thinShell, direction=code_block_3)
code_block_4 = CodeBlock { Point.ByCoordinates(0,0,5); }
ZAxis = Vector.ZAxis()
# note: 절단할 솔리드를 통과하는 평면 만들기
byOriginNormal = Plane.ByOriginNormal(origin=code_block_4, normal=ZAxis)
# note: 이 점은 솔리드의 자를 부분을 결정합니다.
code_block_5 = CodeBlock { Point.ByCoordinates(10,10,10); }

# group: 로프트 -
# note: 형상 카테고리에서는 (교차, 차이, 결합 등) 기하학적 부울 연산을 사용할 수 있습니다.
trim = Geometry.Trim(geometry=translate_2, other=byOriginNormal, pick=code_block_5)
