# Dynamo graph Geometry_Surfaces.dyn (Dynamo 3.1.0.3411)
# 표면을 만드는 기본 방법인 돌출, 로프트 및 스윕을 보여주는 Dynamo 그래프입니다.

# group: 정보
# note: 돌출, 로프트 및 스윕과 같은 표면을 만드는 주요 방법을 보여주는 Dynamo 그래프

# group: 입력
number = DoubleInput(10)
number_2 = DoubleInput(-10)
byCoordinates = Point.ByCoordinates(x=number, y=number_2)
byCoordinates_2 = Point.ByCoordinates(y=number_2)

# group: 선
byStartPointEndPoint = Line.ByStartPointEndPoint(startPoint=byCoordinates, endPoint=byCoordinates_2)

# group: 입력
byCoordinates_3 = Point.ByCoordinates()

# group: 입력
number_3 = DoubleInput(5)
byCoordinates_4 = Point.ByCoordinates(z=number_3)

# group: 입력
number_4 = DoubleInput(10)
byCoordinates_5 = Point.ByCoordinates(x=number_4)
byCoordinates_6 = Point.ByCoordinates(y=number_4)

# group: 호
byThreePoints = Arc.ByThreePoints(firstPoint=byCoordinates_3, secondPoint=byCoordinates_4, thirdPoint=byCoordinates_5)

# group: 로프트
create = List.Create(item0=byStartPointEndPoint, item1=byThreePoints)
# note: 두 세트의 곡선을 사용하여 곡선 사이에 '로프트' 형상을 만들 수 있습니다.
byLoft = Surface.ByLoft(crossSections=create)

# group: 로프트 면적 평가
area = Surface.Area(surface=byLoft)
watch = Watch(area)

# group: 입력
number_5 = DoubleInput(5)
number_6 = DoubleInput(10)
byCoordinates_7 = Point.ByCoordinates(x=number_5, y=number_6, z=number_6)

# group: 입력
number_7 = DoubleInput(15)
byCoordinates_8 = Point.ByCoordinates(x=number_7, y=number_7)

# group: 호
byThreePoints_2 = Arc.ByThreePoints(firstPoint=byCoordinates_6, secondPoint=byCoordinates_7, thirdPoint=byCoordinates_8)

# group: 입력
number_8 = DoubleInput(-5)
number_9 = DoubleInput(5)
byCoordinates_9 = Point.ByCoordinates(x=number_8, y=number_9)

# group: 호
byThreePoints_3 = Arc.ByThreePoints(firstPoint=byCoordinates_3, secondPoint=byCoordinates_9, thirdPoint=byCoordinates_6)

# group: 스윕
# note: 대부분 표면의 경우 여러 가지 만들기 방법이 있습니다. 표면, Polysurface(표면 모음) 및 Nurbs 표면은 점, 곡선으로 만들 수 있으며 다른 표면 및 솔리드에서 파생될 수 있습니다
bySweep2Rails = Surface.BySweep2Rails(path=byThreePoints_2, guideRail=byThreePoints, profile=byThreePoints_3)

# group: 로프트와 스윕 결합
create_2 = List.Create(item0=byLoft, item1=bySweep2Rails)
# note: Polysurface로 결합된 표면은 단일 도면요소로 평가할 수 있습니다
byJoinedSurfaces = PolySurface.ByJoinedSurfaces(surfaces=create_2)

# group: 결합된 로프트 + 스윕 면적 평가
area_2 = Surface.Area(surface=byJoinedSurfaces)
watch_2 = Watch(area_2)

# group: 스윕 면적 평가
area_3 = Surface.Area(surface=bySweep2Rails)
watch_3 = Watch(area_3)

# group: 표면에서 점 추출 및 사용
code_block = CodeBlock { 0..1..0.1; }
# note: 모서리, 점 및 기타 피처는 해당 형상에 적절한 "동작"을 사용하여 표면에서 파생될 수 있습니다
pointAtParameter = Surface.PointAtParameter(surface=bySweep2Rails, u=code_block, v=code_block, lacing=CrossProduct)
# note: 추출된 매개변수(점)로 새 Nurbs 표면을 만듭니다.
# 나머지 형상을 숨기고 아래의 형상 결과를 관찰합니다.
byControlPoints = NurbsSurface.ByControlPoints(controlVertices=pointAtParameter)
watch_3d = Watch3D(byControlPoints)

# group: 돌출
code_block_2 = CodeBlock { 10; }
# note: 제공된 곡선에서 기본 돌출 수행
extrude = Curve.Extrude(curve=byThreePoints_2, distance=code_block_2)
