# Dynamo graph ImportExport_CSV to Stuff.dyn (Dynamo 3.1.0.3411)
# author: Dynamo Team
# 구문 분석된 csv 데이터를 기반으로 형상을 만듭니다.

# group: 초기 helix.csv 입력
# note: x, y 및 z 좌표 공간에 숫자가 있는
# CSV 파일 탐색
file_path = Filename("..\..\Data\helix.csv")

# group: 파일 읽기
fromPath = FileObject(path=file_path)  # "File.FromPath"
readText = FileSystem.ReadText(file=fromPath)

# group: csv 데이터 구문 분석
string = StringInput("\n")
# note: 줄 바꿈 <enter>의
# 문자열 분할
split = String.Split(string=readText, separator0=string)
string_2 = StringInput(",")
# note: 쉼표의 문자열 분할
split_2 = String.Split(string=split, separator0=string_2)
# note: CSV 파일은 숫자가 아니라 문자열을 제공합니다
toNumber = String.ToNumber(string=split_2)
# note: X, Y, 및 Z 구성요소 그룹화
transpose = List.Transpose(lists=toNumber)

# group: csv 파일에서 검색된 점을 기반으로 '나선형' 형상 작성
# note: 'X' 좌표
firstItem = List.FirstItem(list=transpose)
code_block = CodeBlock { 1; }
# note: 'Y' 좌표
getItemAtIndex = List.GetItemAtIndex(list=transpose, index=code_block)
# note: 'Z' 좌표
lastItem = List.LastItem(list=transpose)
byCoordinates = Point.ByCoordinates(x=firstItem, y=getItemAtIndex, z=lastItem)

# group: 확장
number_slider = DoubleSlider(2.337, range=0..20 step 0.1)
# note: 좌표점의 전체 분포 조정
scale = Geometry.Scale(geometry=byCoordinates, amount=number_slider, lacing=Longest)
