# Dynamo graph ImportExport_Data To Excel.dyn (Dynamo 3.1.0.3411)
# author: Dynamo Team
# Dynamo에서 .csv 파일로 데이터를 내보내는 방법을 설명합니다.

# group: 제목 <그룹 제목을 편집하려면 여기를 두 번 클릭하십시오.>
number_slider = DoubleSlider(1.793, range=0..5 step 0.1)

# group: 제목 <그룹 제목을 편집하려면 여기를 두 번 클릭하십시오.>
# 설명 <그룹 설명을 편집하려면 여기를 두 번 클릭하십시오.>
# note: 새 참고
code_block = CodeBlock(numCircles=number_slider) { 0..(360*numCircles)..10; }
cos = Math.Cos(angle=code_block, lacing=Longest)
sin = Math.Sin(angle=code_block, lacing=Longest)
code_block_2 = CodeBlock(x=code_block) { x/100; }
byCoordinates = Point.ByCoordinates(x=cos, y=sin, z=code_block_2, lacing=Longest)
code_block_3 = CodeBlock(pt=byCoordinates) { [pt.X,pt.Y,pt.Z]; }

# group: 제목 <그룹 제목을 편집하려면 여기를 두 번 클릭하십시오.>
# 설명 <그룹 설명을 편집하려면 여기를 두 번 클릭하십시오.>
# note: 새 참고
file_path = Filename("..\..\Data\icosohedron_points.csv")
string = StringInput("helix")
number = DoubleInput(0)
transpose = List.Transpose(lists=code_block_3)
exportToExcel = Data.ExportToExcel(filePath=file_path, sheetName=string, startRow=number, startColumn=number, data=transpose)
