# Dynamo graph ImportExport_Excel to Dynamo.dyn (Dynamo 3.1.0.3411)
# author: Dynamo Team
# Excel에서 Dynamo로 데이터를 가져오는 방법을 보여주는 샘플 그래프입니다.

# group: 초기 입력
# note: 데이터를 로드할 .xlsx Excel 파일 경로로 이동합니다.
file_path = Filename("..\..\Data\helix.xlsx")
# note: 파일 경로에서 파일을 가져옵니다.
fromPath = FileObject(path=file_path)  # "File.FromPath"
# note: 가져올 데이터가 포함된 Excel의 워크시트 이름입니다.
string = StringInput("helix")

# group: Excel 데이터 가져오기
# note: 이 노드는 Excel 워크시트에서 가져온 데이터를 읽을 수 있습니다. 모든 열과 행에서 데이터를 읽으며, 결과 데이터는 이중 배열 [][](행렬)로 포함됩니다.
importExcel = Data.ImportExcel(file=fromPath, sheetName=string)

# group: 전치
# note: 리스트(행렬)를 반전(전치)합니다. 열은 행이 되고 행은 열이 됩니다.
transpose = List.Transpose(lists=importExcel)

# group: 점의 좌표 추출
number = DoubleInput(0)
# note: X 좌표
getItemAtIndex = List.GetItemAtIndex(list=transpose, index=number)
number_2 = DoubleInput(1)
# note: Y 좌표
getItemAtIndex_2 = List.GetItemAtIndex(list=transpose, index=number_2)
number_3 = DoubleInput(2)
# note: Z 좌표
getItemAtIndex_3 = List.GetItemAtIndex(list=transpose, index=number_3)

# group: Excel에서 추출된 데이터를 기반으로 나선 작성
byCoordinates = Point.ByCoordinates(x=getItemAtIndex, y=getItemAtIndex_2, z=getItemAtIndex_3, lacing=Longest)
