# Dynamo graph OpenXMLExport_Data To Excel.dyn "OpenXMLExport_Data를 Excel로" (Dynamo 3.0.3.7594)
# author: Dynamo Team
# Excel로 데이터를 내보내는 방법을 보여주는 Dynamo 샘플 그래프입니다.

# group: 초기 입력
# note: 점 수를 산출합니다. 이 값을 나선의 '높이'로 생각합니다.
number_slider = DoubleSlider(1.7, range=0..5 step 0.1)

# group: 나선 만들기
# note: 0부터 시작하여 일련의 숫자를 만듭니다. 10씩 증분됩니다. 점 개수에 360을 곱합니다. 따라서 'numCircles' 입력이 1이면 결과는 37개 숫자(0 - 360)가 되고 나선이 한 번 완전히 회전하게 됩니다.
code_block = CodeBlock(numCircles=number_slider) { 0..(360*numCircles)..10; }
# note: 코사인 함수
cos = Math.Cos(angle=code_block, lacing=Longest)
# note: 사인 함수
sin = Math.Sin(angle=code_block, lacing=Longest)
# note: 100으로 나누기
code_block_2 = CodeBlock(x=code_block) { x/100; }
# note: 점 리스트를 작성합니다. X 구성요소는 코사인, Y는 사인, Z는 초기 값을 100으로 나눈 값입니다.
byCoordinates = Point.ByCoordinates(x=cos, y=sin, z=code_block_2, lacing=Longest)
# note: 점 리스트에서 리스트 구조를 만듭니다. 그러면 각각 X, Y 및 Z 점 좌표를 포함하는 3개의 리스트([][] - 이중 배열)가 포함된 리스트가 생성됩니다.
code_block_3 = CodeBlock(pt=byCoordinates) { [pt.X,pt.Y,pt.Z]; }

# group: 내보낼 입력 만들기
# 1. csv 파일의 경로.
# 2. 워크시트의 이름.
# 3. 점의 전치 리스트.
# 4. Excel 내 행과 열의 시작 색인.
# note: xlsx 파일의 파일 경로입니다.
file_path = Filename("...\. \Data\icosohedron_points.xlsx")
# note: Excel의 워크시트 이름입니다.
string = StringInput("helix")
# note: 행렬을 반전합니다(리스트 전치). 열은 행이 되고 행은 열이 됩니다.
transpose = List.Transpose(lists=code_block_3)
# note: Excel에서 데이터 기록을 시작할 열/행의 수
number = DoubleInput(0)

# group: Excel 파일로 데이터 내보내기
# note: Excel로 데이터 내보내기
openXMLExportExcel = Data.OpenXMLExportExcel(filePath=file_path, sheetName=string, data=transpose, startRow=number, startColumn=number)
