# Dynamo graph OpenXMLImport_Data From Excel.dyn "Excel에서 OpenXMLImport_Data" (Dynamo 3.1.0.3411)
# author: Dynamo Team
# Excel 파일에서 데이터를 가져오는 방법을 보여주는 샘플 그래프입니다.

# group: 초기 입력
# 1. Excel 파일의 파일 경로.
# 2. 워크시트의 이름
file_path = Filename("..\..\Data\helix.xlsx")
string = StringInput("helix")

# group: Excel에서 데이터 추출
# note: Excel에서 데이터 읽기
openXMLImportExcel = Data.OpenXMLImportExcel(filePath=file_path, sheetName=string)

# group: Excel에서 데이터 구문 분석
# 데이터 '구문 분석'은 데이터를 사용하기 전에 데이터 소스를 네이티브 환경으로 만드는 방식으로 조작하는 프로세스입니다.
# note: 리스트를 전치합니다(행렬 반전). 열은 행이 되고 행은 열이 됩니다.
transpose = List.Transpose(lists=openXMLImportExcel)
# note: 첫 번째 리스트
number = DoubleInput(0)
# note: 두 번째 리스트
number_2 = DoubleInput(1)
# note: 세 번째 리스트
number_3 = DoubleInput(2)

# group: 나선 만들기
# note: X 좌표
getItemAtIndex = List.GetItemAtIndex(list=transpose, index=number)
# note: Y 좌표
getItemAtIndex_2 = List.GetItemAtIndex(list=transpose, index=number_2)
# note: Z 좌표
getItemAtIndex_3 = List.GetItemAtIndex(list=transpose, index=number_3)
byCoordinates = Point.ByCoordinates(x=getItemAtIndex, y=getItemAtIndex_2, z=getItemAtIndex_3, lacing=Longest)
