# Dynamo graph Basics_Basic01.dyn (Dynamo 2.19.3.6543)
# author: Dynamo Team
# Połącz węzły, aby dodać dwie liczby

# note: Podstawowe funkcjonalne dane wejściowe, takie jak liczby i ciągi znaków, można wybrać, przeglądając lub wyszukując po lewej stronie obszaru projektowania.
# Operacje na danych, takie jak transformacje matematyczne i geometryczne, są również dostępne w bibliotece
# note: Dodatek Dynamo jest wizualnym językiem programowania. Podobnie jak inne języki, działa poprzez łączenie prostych elementów, aby utworzyć bardziej złożone koncepcje
# note: Wyciągnij złącze poza port „>” na węzeł Number i połącz je z portem „y” + na węźle +, a następnie kliknij przycisk „Uruchom” w lewym dolnym rogu okna aplikacji.
number = DoubleInput(2)  # graph input
add = number + _  # unwired: y
# note: Dane można wizualizować, klikając przycisk Uruchom w prawym dolnym rogu okna aplikacji. Po włączeniu trybu uruchamiania „Automatyczne” aplikacja będzie stale aktualizowana.
# Dane można wyświetlić albo za pomocą węzła Watch, albo klikając mały kwadracik znajdujący się u dołu większości węzłów.
watch = Watch(add)
# note: Kilka przykładowych plików można znaleźć w menu Pomoc. Można też zamknąć ten plik, klikając przycisk „X” na karcie, aby powrócić do strony startowej
number_2 = DoubleInput(6)  # graph input
