# Dynamo graph Basics_Basic02.dyn (Dynamo 2.19.3.6543)
# author: Dynamo Team
# Utwórz linię, łącząc dwa punkty

# note: Manipuluj położeniem punktu w środowisku Dynamo: wybierz węzeł Point.ByCoordinates i przełącz na podgląd tła, aby przeciągnąć punkt wzdłuż jego trzech osi.
byCoordinates = Point.ByCoordinates()
# note: Dane geometryczne można wyświetlać jako informacje tekstowe lub w przestrzeni 3D
watch = Watch(byCoordinates)
number = DoubleInput(2)  # graph input
# note: Użyj węzła Number Slider lub Integer Slider, aby dynamicznie wprowadzać wartość z określonego zakresu. Kliknij niebieską strzałkę listy rozwijanej, aby otworzyć ustawienia zakresu liczbowego
number_slider = DoubleSlider(4.43, range=0..10 step 0.1)  # graph input
# note: Między nawigacją po tle 3D i nawigacją po widoku wykresu można przełączać za pomocą przycisków w prawym górnym rogu ekranu (skrót Ctrl + B). Podgląd tła można również włączać i wyłączać w menu Widok — w przypadku dodatku Dynamo i programu Revit.
byCoordinates_2 = Point.ByCoordinates(x=number, z=number_slider)
byStartPointEndPoint = Line.ByStartPointEndPoint(startPoint=byCoordinates_2, endPoint=byCoordinates)
# note: Użyj węzła Watch 3D, aby zwizualizować element 3D osobno
watch_3d = Watch3D(byStartPointEndPoint)
