# Dynamo graph Basics_Basic03.dyn (Dynamo 2.19.3.6543)
# author: Dynamo Team
# Utwórz prostą listę

# group: Dane wejściowe
# note: Listy danych mogą być generowane za pomocą sekwencji i zakresów. Listy te można reorganizować, używając wielu innych węzłów do określonych celów
number = DoubleInput(0)  # graph input
number_2 = DoubleInput(9)  # graph input
number_3 = DoubleInput(1)  # graph input

# note: Utwórz sekwencję liczb, zaczynając od wartości Start, kończąc na wartości End, z krokiem Step
range = Range(start=number, end=number_2, step=number_3, lacing=Longest)
watch = Watch(range)
number_4 = DoubleInput(3)  # graph input
# note: Podziel listę na fragmenty o długości 3
chop = List.Chop(list=range, lengths=number_4)
# note: Wyświetl podgląd wyniku i obserwuj strukturę listy za pomocą węzła Watch
watch_2 = Watch(chop)
# note: Pobierz ostatni element z listy
lastItem = List.LastItem(list=range)
watch_3 = Watch(lastItem)
