# Dynamo graph Core_AttractorPoint.dyn (Dynamo 3.0.0.6964)
# author: Dynamo Team
# Ten wykres tworzy siatkę walców z rozmiarami określonymi na podstawie położenia punktu przyciągania.

# group: Informacje
# note: PUNKT PRZYCIĄGANIA
# Punkt przyciągania jest punktem (lub elementem) odniesienia, który wpływa na cechy innych elementów w układzie. Punkt przyciągania często działa jak magnes — im bliżej punktu przyciągania znajduje się element, tym większy jest wpływ punktu przyciągania na ten element.
# W tym przykładzie wysokości i średnice walców są określane na podstawie odległości między poszczególnymi walcami a przesuwającym się punktem przyciągania. Walce w pobliżu punktu przyciągania są mniejsze niż te znajdujące się dalej.
# Aby zwizualizować to zachowanie, przesuń suwaki dwóch węzłów Number Slider danych wejściowych punktu przyciągania.
# Punkty przyciągania umożliwiają wprowadzenie do procesu projektowania pewnego poziomu reagowania i dynamicznego zachowania.

# group: Rozmiar siatki punktów
# note: Utwórz sekwencję liczb za pomocą węzła Code Block. W tym przypadku tworzona jest sekwencja liczb z przedziału od 1 do 50 z liczbą kroków n, w której każdy krok ma wartość 5
zakres_liczb = CodeBlock { 1..50..5; }

# group: Utwórz siatkę punktów
# note: Siatka punktów.
# Aby utworzyć, przekaż serię liczb do dwóch portów — współrzędnych X i Y. Kliknij prawym przyciskiem myszy węzeł i zmień skratowanie na „Iloczyn wektorowy”
# note: Skratowanie ustawione na iloczyn wektorowy węzła powoduje połączenie każdego elementu z jednej listy z każdym elementem z drugiej listy, tworząc strukturę list podobną do siatki.
# W przypadku używania tego z danymi wejściowymi X i Y węzła 'Point.ByCoordinates' wynikiem jest płaska siatka punktów. Jeśli używana jest trzecia współrzędna Z, wynikiem jest siatka punktów w kształcie sześcianu.
byCoordinates = Point.ByCoordinates(x=zakres_liczb, y=zakres_liczb, lacing=CrossProduct)

# group: Spłaszcz strukturę listy
# Złożona struktura listy nie jest wymagana do dalszych operacji dotyczących punktów. Spłaszcz za pomocą węzła Flatten, aby wygenerować tylko jedną listę.
# note: Spłaszcz listę, ponieważ hierarchia wierszy i kolumn nie jest potrzebna. Porównaj dane wejściowe tego węzła z danymi wyjściowymi — struktura w postaci N list zmieniła się w tylko jedną listę.
flatten = List.Flatten(list=byCoordinates)

# group: Położenie punktu przyciągania
number_slider = DoubleSlider(24.6, range=-10..60 step 0.1)  # graph input
number_slider_2 = DoubleSlider(11.50111001, range=-10..60 step 0.1)  # graph input
# note: Punkt przyciągania. Przenieś suwaki danych wejściowych, aby dopasować położenie tego punktu.
byCoordinates_2 = Point.ByCoordinates(x=number_slider, y=number_slider_2)

# group: Odległość do punktu przyciągania
# note: Znajduje odległość między punktem przyciągania a poszczególnymi punktami bazowymi walców
distanceTo = Geometry.DistanceTo(geometry=flatten, other=byCoordinates_2)

# group: Wygeneruj promienie i wysokości
# note: Formuła umożliwiająca dostosowywanie wysokości walców w reakcji na lokalizację punktu przyciągania. W tym przykładzie wysokość każdego walca jest o połowę mniejsza od odległości do punktu przyciągania. Użyj innej formuły.
wysokość_walca = CodeBlock(x=distanceTo) { x/2; }
# note: Formuła zwraca wartość mającą być promieniem walca. Im większa odległość, tym większy promień walca. Użyj innej formuły.
promień_walca = CodeBlock(x=distanceTo) { x/15; }

# group: Punkty końcowe
# Przekształć punkt początkowy (oryginalny) każdego walca o podaną wysokość zdefiniowaną za pomocą formuły
# note: Wektor do przesunięcia punktu bazowego (oryginalnego) w górę o podaną wartość
byCoordinates_3 = Vector.ByCoordinates(z=wysokość_walca)
# note: Dodaj tę nową wartość Z (wysokość) do oryginalnych punktów siatki, aby uzyskać punkty górne walców.
add = Point.Add(point=flatten, vectorToAdd=byCoordinates_3)

# group: Utwórz walce
# note: Użyj metody, która tworzy walec z podanymi punktem początkowym, punktem końcowym i promieniem
byPointsRadius = Cylinder.ByPointsRadius(startPoint=flatten, endPoint=add, radius=promień_walca)
