# Dynamo graph Core_CodeBlocks.dyn (Dynamo 3.4.1.7055)
# author: Dynamo Team
# Ten wykres pozwala przeanalizować różne zastosowania węzłów Code Block

# group: Informacje
# note: WĘZŁY CODE BLOCK
# Węzły Code Block można tworzyć, klikając dwukrotnie w obszarze rysunku. Węzeł Code Block można również znaleźć w bibliotece węzłów w kategorii Script > Editor.
# Węzły Code Block mogą przechowywać:
# •  Wartości liczbowe (liczby całkowite i liczby zmiennoprzecinkowe)
# •  Ciągi (tekst)
# •  Wartości logiczne (True — „prawda” lub False — „fałsz”)
# •  Listy [0,1,2]
# •  Wyrażenia (a+3)
# •  Zmienne
# Inne węzły można przekształcić w wyrażenia węzłów Code Block: wybierz jeden lub więcej węzłów i kliknij prawym przyciskiem myszy w obszarze między węzłami, aby wybrać opcję 'Konwersja węzłów na kod'. Nie ma polecenia będącego odwrotnością tego działania — nie można automatycznie przekształcać węzłów Code Block w węzły.

# group: Węzły jako węzły Code Block
# note: Za pomocą węzłów Code Block można wywoływać dowolne inne węzły w bibliotece. Węzły w bibliotece są zazwyczaj jednego z trzech typów:
#     Tworzenie:	utwórz element
#     Operacja:	wykonaj operację na elemencie
#     Zapytanie:	pobierz właściwość elementu,
# 		który już istnieje.
# Metody lub węzły tych trzech typów są traktowane w różny sposób w przypadku wywołania ich z poziomu węzła Code Block.

# group: Tworzenie geometrii
# note: Razem instrukcje te tworzą algorytm, który umożliwia utworzenie krzywej spiralnej na punkcie bazowym.
code_block = CodeBlock()
# ---------- code_block.designscript (16 lines) ----------
// Basic inputs
base = Point.ByCoordinates(3,3);
coils = 3;
height = 5;
rad = 0.5;

// Make a series of points
numPts = 8*coils + 1;
seq = 0..(coils*360)..#numPts;
x = rad * Math.Cos(seq);
y = rad * Math.Sin(seq);
z = 0..height..#numPts;
pts = Point.ByCoordinates(x + base.X, y + base.Y, z + base.Z);

// Pass a curve through those points
NurbsCurve.ByPoints(pts);
# ----------------------------------------
# note: Algorytm spirali jest przekształcany w funkcję poprzez nadanie mu nazwy, określenie danych wejściowych i określenie, co ma zwracać.
code_block_2 = CodeBlock()
# ---------- code_block_2.designscript (13 lines) ----------
def MakeSpring(base,coils,height,rad)
{
// Make a series of points
numPts = 8*coils + 1;
seq = 0..(coils*360)..#numPts;
x = rad * Math.Cos(seq);
y = rad * Math.Sin(seq);
z = 0..height..#numPts;
pts = Point.ByCoordinates(x + base.X, y + base.Y, z + base.Z);

// Return the curve that passes through those points
return = NurbsCurve.ByPoints(pts);
};
# ----------------------------------------
code_block_3 = CodeBlock { 0..6..2; }
code_block_4 = CodeBlock { 10..20..2; }
# note: Algorytm spirali jest przekształcany, tak aby zdefiniować funkcję z umowną nazwą „MakeSpring”. Ta funkcja jest wywoływana, aby utworzyć kilka sprężyn o losowej wysokości, ułożonych w siatce.
# note: tworzy siatkę
byCoordinates = Point.ByCoordinates(x=code_block_3, y=code_block_4, lacing=CrossProduct)
flatten = List.Flatten(list=byCoordinates)
code_block_5 = CodeBlock { 5; }
count = List.Count(list=flatten)
# note: generuje serię losowych numerów (skalowanych przez 5) dla wysokości sprężyny
randomList = Math.RandomList(amount=count)
code_block_6 = CodeBlock(random=randomList) { random * 5; }
# note: Dane wejściowe do wywołań funkcji mogą składać się z list elementów lub elementów o pojedynczej wartości. Dane mogą być przekazywane przez port lub deklarowane bezpośrednio, tak jak w przypadku „0,5” dla promieni wszystkich sprężyn.
code_block_7 = CodeBlock(basePoints=flatten, numCoils=code_block_5, height=code_block_6) { MakeSpring(basePoints,numCoils,height,0.5); }

# group: Funkcje
# note: Funkcje mogą być definiowane bezpośrednio w węźle bloku kodu, aby mogły być wywoływane w innym miejscu w tej definicji.
# Pierwszy wiersz zawiera słowo kluczowe „def”, następnie nazwę funkcji, a na koniec dane wejściowe w nawiasach.
# Nawiasy klamrowe określają główną część funkcji. Każdy wiersz musi kończyć się średnikiem.
# Zwróć wartość za pomocą polecenia „return =”.
code_block_8 = CodeBlock()
# ---------- code_block_8.designscript (11 lines) ----------
/* This is a multi-line comment,
     which continues for mulitple
     lines. */

def FunctionName(input1, input2)
{
// This is a comment
sum = input1 + input2;

return = sum;
};
# ----------------------------------------
code_block_9 = CodeBlock { 1; }
# note: Węzły bloku kodu, które definiują funkcję, nie mają portów wejściowych ani wyjściowych, ponieważ są wywoływane z innych węzłów bloku kodu.
code_block_10 = CodeBlock { 2; }
# note: Wywołaj funkcję z innym węzłem bloku kodu w tym samym pliku przez podanie takiej samej nazwy i liczby argumentów.
code_block_11 = CodeBlock(in1=code_block_9, in2=code_block_10) { FunctionName(in1,in2); }
watch = Watch(code_block_11)
code_block_12 = CodeBlock { "cat"; }
code_block_13 = CodeBlock { "dog"; }
# note: Typ argumentów wejściowych nie jest określony w definicji funkcji, dlatego będzie działać na dowolnym otrzymanym elemencie.
code_block_14 = CodeBlock(in1=code_block_12, in2=code_block_13) { FunctionName(in1,in2); }
watch_2 = Watch(code_block_14)
origin = Point.Origin()
code_block_15 = CodeBlock { 16; }
# note: Wywołanie funkcji z danych wejściowych, które nie nadają się dla tej funkcji, zwraca pusty wynik.
code_block_16 = CodeBlock(in1=origin, in2=code_block_15) { FunctionName(in1,in2); }
watch_3 = Watch(code_block_16)

# group: Wartości liczbowe
# Porównaj węzły wyspecjalizowane z węzłem Code Block
# note: Wyspecjalizowany
number = DoubleInput(3.14)
wynik = Watch(number)
# note: Code Block
code_block_17 = CodeBlock { 3.140; }
watch_4 = Watch(code_block_17)

# group: Wartości ciągów
# Porównaj węzły wyspecjalizowane z węzłem Code Block
# note: Wyspecjalizowany
string = StringInput("Less is more.")
wynik_2 = Watch(string)
# note: Użyj cudzysłowów "", aby utworzyć ciąg za pomocą węzła Code Block
code_block_18 = CodeBlock { "Less is more."; }
watch_5 = Watch(code_block_18)
# note: Użyj tego węzła, aby wyświetlić typ wartości wyjściowej
type = Object.Type(object=code_block_18)
watch_6 = Watch(type)

# group: Wyrażenia
# Wykonaj operację mnożenia za pomocą węzła wyspecjalizowanego * i za pomocą węzła Code Block
number_2 = DoubleInput(3)
number_3 = DoubleInput(5)
# note: Pomnóż dwie liczby przy użyciu węzła *
mul = number_2 * number_3
wynik_3 = Watch(mul)
# note: Wykonaj mnożenie za pomocą węzła Code Block
code_block_19 = CodeBlock { 3*5; }
watch_7 = Watch(code_block_19)
code_block_20 = CodeBlock { 3; }
code_block_21 = CodeBlock { 5; }
# note: Użyj zmiennych jako danych wejściowych operacji mnożenia.
code_block_22 = CodeBlock(a=code_block_20, b=code_block_21) { a*b; }
watch_8 = Watch(code_block_22)

# group: Zapytanie
# Metody wykonujące zapytania i zwracające właściwość obiektu
# note: Bloki kodu pozwalają użytkownikowi zdecydować, w jaki sposób będą określane dane wejściowe. Oto kilka różnych sposobów, na przykład na utworzenie tego samego punktu.
code_block_23 = CodeBlock { 10; }
code_block_24 = CodeBlock { -10; }
# note: Gotowa metoda z użyciem węzła Point.ByCoordinates
byCoordinates_2 = Point.ByCoordinates(x=code_block_23, y=code_block_24)
watch_9 = Watch(byCoordinates_2)
# note: Węzeł Code Block używa metody Point.ByCoordinates z trzema zmiennymi dla współrzędnych X, Y i Z, przy czym wartość Z jest zdefiniowana w tym samym węźle Code Block i oddzielona średnikiem ';'
code_block_25 = CodeBlock(x=code_block_23, y=code_block_24) { z = 0; Point.ByCoordinates(x,y,z); }
watch_10 = Watch(code_block_25.out1)
code_block_26 = CodeBlock { Point.ByCoordinates(10,0,0); }
# note: odpowiednik tej samej metody utworzony za pomocą węzła Code Block. Metody zapytań nie wymagają nawiasów
code_block_27 = CodeBlock(pt=code_block_26) { pt.X; }
watch_11 = Watch(code_block_27)
# note: Gotowa metoda zapytania, która zwraca współrzędną X punktu
X = Point.X(point=code_block_26)
watch_12 = Watch(X)
# note: Formuła użycia wartości ujemnej o tej samej wartości liczbowej jest zintegrowana z zapisem zmiennych wejściowych
code_block_28 = CodeBlock(num=code_block_23) { Point.ByCoordinates(num,-num,0); }
watch_13 = Watch(code_block_28)
# note: Węzeł Code Block używa metody Point.ByCoordinates, wszystkie trzy zmienne są przekazywane jako dane wejściowe
code_block_29 = CodeBlock { Point.ByCoordinates(10,-10,0); }
watch_14 = Watch(code_block_29)

# group: Utwórz
# Metody tworzące geometrię, listy, elementy programu Revit lub inne obiekty
# note: Gotowa metoda tworzenia punktu w punkcie początkowym
origin_2 = Point.Origin()
watch_15 = Watch(origin_2)
# note: Mimo że ta metoda nie wymaga danych wejściowych, wymagane są nawiasy
code_block_30 = CodeBlock { Point.Origin(); }
watch_16 = Watch(code_block_30)
code_block_31 = CodeBlock { 0; -10; }
# note: Gotowa metoda tworzenia punktu przez podanie współrzędnych X i Y
byCoordinates_3 = Point.ByCoordinates(x=code_block_31.out0, y=code_block_31.out1)
watch_17 = Watch(byCoordinates_3)
# note: Użyj węzła Code Block, aby zreplikować zachowanie węzła Point.ByCoordinates. Nazwę metody można znaleźć, umieszczając wskaźnik myszy na oryginalnym, gotowym węźle: metoda jest podana u dołu okna etykiety narzędzia.
# Dane wejściowe muszą być określone w kolejności używanej w gotowym węźle.
code_block_32 = CodeBlock { Point.ByCoordinates(0,-10); }
watch_18 = Watch(code_block_32)

# group: Operacja
# Metody wykonująca operację na obiekcie
origin_3 = Point.Origin()
ZAxis = Vector.ZAxis()
# note: Gotowa metoda dodawania wektora do punktu
add = Point.Add(point=origin_3, vectorToAdd=ZAxis)
watch_19 = Watch(add)
origin_4 = Point.Origin()
ZAxis_2 = Vector.ZAxis()
# note: Metody dotyczące operacji są wykonywane na obiekcie. Użyj zapisu kropkowego po nazwie obiektu i określ metodę oraz wszystkie dane wejściowe używane w gotowym węźle z wyjątkiem pierwszej pozycji (ponieważ pierwszy port wejściowy pobiera sam obiekt, który jest już podany)
code_block_33 = CodeBlock(pt=origin_4, vector=ZAxis_2) { pt.Add(vector); }
watch_20 = Watch(code_block_33)

# group: Utwórz listy
# note: Utwórz listy, używając nawiasów kwadratowych, aby zdefiniować listę, i przecinków, aby rozdzielić poszczególne elementy
code_block_34 = CodeBlock { ["San Francisco","New York","Chicago"]; }
watch_21 = Watch(code_block_34)
# note: Pobierz elementy z listy, używając następującego zapisu: lista [ i ], gdzie i jest indeksem elementu. Ta metoda jest identyczna z używaniem węzła GetItemAtIndex
code_block_35 = CodeBlock(cities=watch_21) { cities[2]; }
watch_22 = Watch(code_block_35)
# note: W tym samym węźle Code Block zdefiniowano wiele zmiennych, a na końcu tworzona jest lista zawierająca je wszystkie.
code_block_36 = CodeBlock()
# ---------- code_block_36.designscript (7 lines) ----------
str0 = "alpha";
str1 = "beta";
str2 = "charlie";
str3 = "delta";
str4 = "echo";
//
[str0,str1,str2,str3,str4];
# ----------------------------------------
watch_23 = Watch(code_block_36.out5)
code_block_37 = CodeBlock(phonetic=watch_23) { phonetic[2..3]; }
watch_24 = Watch(code_block_37)
code_block_38 = CodeBlock { 2; }
getItemAtIndex = List.GetItemAtIndex(list=watch_21, index=code_block_38)
watch_25 = Watch(getItemAtIndex)

# group: Połącz listy i uzyskaj dostęp do elementów list
# Opis <Kliknij dwukrotnie tutaj, aby edytować opis grupy>
# note: Utwórz zagnieżdżone listy i pobierz elementy z zagnieżdżonych list.
code_block_39 = CodeBlock()
# ---------- code_block_39.designscript (6 lines) ----------
kitchen = ["table","stove","sink","refrigerator"];
livingRoom = ["sofa","books"];
bedroom = ["bed","dirty clothes"];
bathroom = ["tooth brush"];
//
allMyStuff = [kitchen, livingRoom, bedroom, bathroom];
# ----------------------------------------
watch_26 = Watch(code_block_39.allMyStuff)
# note: Uzyskaj dostęp do drugiego elementu z trzeciej listy (czyli do elementu o indeksie '1' na liście o indeksie '2')
code_block_40 = CodeBlock(list=watch_26) { list[2][1]; }
watch_27 = Watch(code_block_40)

# group: Replikacja
# note: Prowadnice replikacji można wykorzystać do określenia, by listy były kratowane jako iloczyn wektorowy.
code_block_41 = CodeBlock { x_vals = 0..10; y_vals = -30..-40; }
code_block_42 = CodeBlock(x_vals=code_block_41.x_vals, y_vals=code_block_41.y_vals) { Point.ByCoordinates(x_vals, y_vals); }
code_block_43 = CodeBlock { x_vals = 0..10; y_vals = -15..-25; }
code_block_44 = CodeBlock(x_vals=code_block_43.x_vals, y_vals=code_block_43.y_vals) { Point.ByCoordinates(x_vals<1>, y_vals<2>); }
byCoordinates_4 = Point.ByCoordinates(x=code_block_41.x_vals, y=code_block_41.y_vals)
byCoordinates_5 = Point.ByCoordinates(x=code_block_43.x_vals, y=code_block_43.y_vals, lacing=CrossProduct)
# note: Prowadnice replikacji, które używają nawiasów ostrokątnych, pobierają dwu- lub trzy-wymiarowe kolekcje
# i łączą ze sobą elementy, aby wygenerować jedno-, dwu- lub trójwymiarową kolekcję.
# note: W tym przykładzie występują 2 wartości x i 5 wartości y. Prowadnice replikacji mogą określić, że wynikowa kombinacja będzie zawierać 2 listy 5 punktów lub 5 list 2 punktów.
code_block_45 = CodeBlock()
# ---------- code_block_45.designscript (5 lines) ----------
x_vals = 0..1;
y_vals = -3..-7;
//
Point.ByCoordinates(x_vals<1>, y_vals<2>);
Point.ByCoordinates(x_vals<2>, y_vals<1>);
# ----------------------------------------
watch_28 = Watch(code_block_45.out2)
watch_29 = Watch(code_block_45.out3)

# group: Wartość logiczna
# Porównaj węzły wyspecjalizowane z węzłem Code Block
# note: Węzeł przełącznika wartości logicznej
boolean = BoolSelector(true)
watch_30 = Watch(boolean)
# note: użyj wartości 'true' (prawda) lub 'false' (fałsz) w węźle Code Block, aby osiągnąć ten sam wynik
code_block_46 = CodeBlock { true; }
watch_31 = Watch(code_block_46)
