# Dynamo graph Core_ListAtLevel.dyn (Dynamo 3.1.0.3411)
# author: Dynamo Team
# Analizujemy funkcję Lista@Poziom i to, jak można za jej pomocą uzyskać takie same wyniki jak za pomocą węzła List.Map. Tworzymy serię paneli, aby pokazać, jak naprawdę działa funkcja Lista@Poziom.

# group: Informacje
# note: Aby określić poziom listy, z którym chcesz pracować, spójrz na dolną część podglądu lub węzeł obserwacyjny i podążaj za liniami od zapisu List@Level w górę.

# group: Informacje
# Ogólne informacje dotyczące korzystania z funkcji Lista@Poziom
# note: LIST@LEVEL
# Polecenie List@Level zastępuje funkcjonalność polecenia List.Map, pozwalając na bezpośredni wybór poziomu listy do pracy.
# note: Aby zmienić poziom listy, z którym pracujesz, kliknij strzałkę znajdującą się obok listy portu wejściowego i włącz opcję „Użyj poziomów”.
# Gdy polecenie List@Level zostaje włączone jako pierwsze w porcie wejściowym, do pracy wybierana jest lista na drugim najbardziej wewnętrznym poziomie (L2).

# group: Informacje
# Jak działa ten wykres
# note: Chcemy utworzyć panele wewnątrz siatki. Aby to zrobić, musimy uzyskać punkty na indeksach 1 i 2 każdej listy na najbardziej wewnętrznym poziomie. Można to łatwo wykonać za pomocą funkcji List@Level. Włączenie opcji „Zachowaj strukturę listy” umożliwi utrzymanie pogrupowania list. Najpierw jednak dokładniej sprawdźmy listę utworzoną przy użyciu polecenia Point.ByCoordinates, aby określić poziom listy, którego chcemy użyć.

# group: Dane wejściowe
# Opis <Kliknij dwukrotnie tutaj, aby edytować opis grupy>
code_block = CodeBlock { 0..30..#8; 12..0..#4; }
# note: W tym przykładzie tworzymy listę 3D zawierającą szereg punktów. Dostępnych jest 8 list na poziomie L3, z których każda lista zawiera kolejne 4 listy (L2). Każda z tych 4 list zawiera 4 punkty (L1) — całkowita liczba punktów wynosi 128.
byCoordinates = Point.ByCoordinates(x=code_block.out0, y=code_block.out1, z=code_block.out1, lacing=CrossProduct)

# group: Zastępowanie funkcji List.Map funkcją List@Level
code_block_2 = CodeBlock { [1,2]; }
# note: W poprzedniej wersji dodatku Dynamo do uzyskania wewnętrznych poziomów list służyło polecenie List.Map. Mimo że ten sam wynik można osiągnąć przy użyciu polecenia List.Map, powoduje to wprowadzenie większej liczby węzłów w obszarze roboczym. Tutaj używamy polecenia List@Level, aby uchwycić wewnętrzne punkty siatki w bardziej efektywny sposób. Użyjemy tych punktów do utworzenia paneli.
# Użyliśmy również opcji „Zachowaj strukturę listy”, aby zachować pogrupowanie listy początkowej i zapobiec zrównaniu. Jeśli opcja „Zachowaj strukturę listy” jest wyłączona, zamiast ośmiu NurbsSurface zostanie utworzone jedno.
getItemAtIndex = List.GetItemAtIndex(list=byCoordinates@@L2, index=code_block_2)
code_block_3 = CodeBlock { [1,2]; }
# note: Listy znajdują się na różnych poziomach, z których L1 to poziom najniższy. Całkowita liczba elementów tworzonych przez ten węzeł wynosi 64, tak jak przedstawiono na ilustracji na dole po prawej stronie.
getItemAtIndex_2 = List.GetItemAtIndex(index=code_block_3)  # unwired: list
# note: Poniżej znajduje się polecenie List.Map równoważne z zastosowaniem polecenia List@Level, które wymaga dodatkowych węzłów
map = List.Map(f_x=getItemAtIndex_2)  # unwired: list
map_2 = List.Map(list=byCoordinates, f_x=map)

# group: Tworzenie geometrii
# note: Możemy teraz utworzyć panele przy użyciu wybranych zestawów punktów.
byPoints = NurbsSurface.ByPoints(points=getItemAtIndex)
byBestFitThroughPoints = Line.ByBestFitThroughPoints(bestFitPoints=getItemAtIndex)

# group: Sprawdzanie listy za pomocą funkcji List@Level i Count
# note: Węzeł List.Count zwraca liczbę elementów znajdujących się na każdej liście. W zależności od wybranego poziomu zwracane są różne wartości. Spróbuj zmienić wartość L3, klikając znajdujące się obok niej strzałki.
# note: Dostępnych jest osiem list na poziomie L3, z których każdy zawiera cztery listy. Wybór poziomu L3 powoduje zatem zaimplementowanie funkcji List.Count na ośmiu listach i wygenerowanie ośmiu wartości „4”.
count = List.Count(list=byCoordinates@L3)

# group: Używanie polecenia Zachowaj strukturę listy
# note: Ten węzeł zwraca liczbę elementów znajdujących się na każdej liście na poziomie L2. Domyślnie wyniki są zrównywane w listę 1D.
count_2 = List.Count(list=byCoordinates@L2)
# note: Aby zachować zagnieżdżoną strukturę list, wybierz opcję „Zachowaj strukturę listy”. „@@” wskazuje, jak struktura listy w DesignScript ma zostać zachowana.
count_3 = List.Count(list=byCoordinates@@L2)

# group: Sprawdzanie listy za pomocą funkcji List@Level i Flatten
# note: Dodatkowym przykładem może być łatwe zrównanie struktury zagnieżdżonej na wewnętrznych poziomach list przy użyciu elementu List@Level wraz z węzłem Flatten. Spróbuj zmienić poziom, który zostanie zrównany, klikając strzałki znajdujące się obok pokrętła List@Level.
# note: Wybranie poziomu L3 powoduje przekształcenie ośmiu list na tym poziomie w szyk 1D. Każda z tych ośmiu list zawiera 4 elementy (które również są listami), spowoduje to zatem zrównanie wszystkich list na poziomie L3 skutkujące utworzeniem ośmiu list z 16 punktami.
flatten = List.Flatten(list=byCoordinates@L3)
