# Dynamo graph Core_ListLacing.dyn (Dynamo 3.1.0.3411)
# author: Dynamo Team
# Skratowanie listy — na tym wykresie przeanalizowano i pokazano wszystkie tryby skratowania listy

# group: Informacje
# note: SKRATOWANIE LISTY
# Skratowanie jest logiką wykorzystywaną przez węzeł dodatku Dynamo do dopasowania do siebie elementów z różnych list. W przypadku większości węzłów w Dynamo można wybrać, jak połączyć listy informacji, przez ustawienie „zachowania skratowania”.
# W każdym z tych przykładów dostępne są dwie listy punktów, które są przekazywane do węzła Line.ByStartPointEndPoint. Węzeł tworzący linię musi określić, ile linii ma być narysowanych i pomiędzy którymi zbiorami punktów.
# Ustaw zachowanie skratowania, klikając prawym przyciskiem myszy węzeł, który ma dwa lub więcej portów wejściowych, i wybierając polecenie „Skratowanie”.

# group: Wskazówka
# note: Wskazówka: Wyświetl indeks elementu jako etykietę w oknie Podgląd tła dla dowolnego węzła tworzącego geometrię. Kliknij prawym przyciskiem myszy i wybierz opcję „Pokaż etykiety”.

# group: Wskazówka
# note: Wskazówka: zachowanie skratowania węzła jest oznaczane na węźle za pomocą małego znacznika w prawym dolnym rogu. Jeśli nie widać żadnego znacznika, węzeł nie jest kratowany.

# group: Dane wejściowe
# note: Dłuższy szereg (10 elementów)
code_block = CodeBlock { 0..9; }
code_block_2 = CodeBlock { 4; }
# note: Krótszy szereg (6 elementów)
code_block_3 = CodeBlock { 0..5; }
code_block_4 = CodeBlock { 0..9; }
code_block_5 = CodeBlock { -10; 4; }
code_block_6 = CodeBlock { 0..5; }
code_block_7 = CodeBlock { 0..9; }
code_block_8 = CodeBlock { 10; 4; }
code_block_9 = CodeBlock { 0..5; }

# group: Utwórz punkty
# Utwórz 2 zestawy punktów dla (10 x 6), które mają być danymi wejściowymi węzła Line.ByStartPointEndPoint
byCoordinates = Point.ByCoordinates(x=code_block, z=code_block_2)
byCoordinates_2 = Point.ByCoordinates(x=code_block_3)

# group: Najdłuższe skratowanie
# note: Najdłuższe skratowanie
# Rysowanych jest tyle linii, ile elementów znajduje się na dłuższej liście punktów wejściowych. Gdy dla węzła zabraknie punktów na krótszej liście, zostanie wykonanych tyle kopii ostatniego elementu, ile będzie potrzebne do dopasowania do końcowych elementów na najdłuższej liście.
byStartPointEndPoint = Line.ByStartPointEndPoint(startPoint=byCoordinates, endPoint=byCoordinates_2, lacing=Longest)

# group: Utwórz punkty
# Utwórz 2 zestawy punktów dla (10 x 6), które mają być danymi wejściowymi węzła Line.ByStartPointEndPoint
byCoordinates_3 = Point.ByCoordinates(x=code_block_4, y=code_block_5.out0, z=code_block_5.out1)
byCoordinates_4 = Point.ByCoordinates(x=code_block_6, y=code_block_5.out0)

# group: Najkrótsze skratowanie
# note: Najkrótsze skratowanie
# Rysowanych jest tylko tyle linii, ile elementów znajduje się na najkrótszej liście danych wejściowych. Punkty „pozostawione” na dłuższej liście są pomijane.
byStartPointEndPoint_2 = Line.ByStartPointEndPoint(startPoint=byCoordinates_3, endPoint=byCoordinates_4)

# group: Utwórz punkty
# Utwórz 2 zestawy punktów dla (10 x 6), które mają być danymi wejściowymi węzła Line.ByStartPointEndPoint
byCoordinates_5 = Point.ByCoordinates(x=code_block_7, y=code_block_8.out0, z=code_block_8.out1)
byCoordinates_6 = Point.ByCoordinates(x=code_block_9, y=code_block_8.out0)

# group: Skratowanie ustawione na iloczyn wektorowy
# note: Skratowanie iloczynu wektorowego
# Wykonywane są wszystkie możliwe kombinacje par. Dla 10 punktów na dłuższej liście i 6 na krótszej powstanie 10 x 6 = 60 linii.
byStartPointEndPoint_3 = Line.ByStartPointEndPoint(startPoint=byCoordinates_5, endPoint=byCoordinates_6, lacing=CrossProduct)
# note: Powstałe linie będą przechowywane na zagnieżdżonej liście, 6 list z 10 liniami albo 10 list z 6 liniami, w zależności od tego, która z list została określona pierwsza.
watch = Watch(byStartPointEndPoint_3)
