# Dynamo graph Core_Math.dyn (Dynamo 3.4.1.7055)
# author: Dynamo Team
# Jest to obszerna analiza różnych funkcji matematycznych i możliwości dodatku Dynamo

# group: Informacje
# note: MATEMATYCZNE
# Operacje matematyczne można wykonywać w dodatku Dynamo za pomocą węzłów z biblioteki Math i biblioteki Operators albo za pomocą węzłów Code Block. Poniżej pokazano, jak można wykonać kilka podstawowych operacji matematycznych za pomocą każdej z tych trzech metod.

# group: Podstawowe operatory arytmetyczne
# note: Operatory arytmetyczne takie jak
# +, -, *, /, %

# group: Podstawowe operatory logiczne
# note: Operatory porównawcze takie jak
# <, >,<=, >=,! =, ==

# group: Operatory logiczne
# note: Operatory logiczne
# (Znajdź inne w bibliotece).

# group: Zaokrąglenie
# note: Zaokrąglenie

# group: Złożone funkcje matematyczne
# 4 przykłady uzyskiwania tego samego wyniku końcowego za pomocą węzłów, języka Python i Fo
# note: W tym przykładzie przedstawiono cztery różne sposoby postępowania z funkcjami matematycznymi. Każdy z tych przykładów rozpoczyna się od siatki punktów, a następnie obliczane są współrzędne z dla punktów i tworzona jest powierzchnia. Różne są tylko metody obliczeń; wszystkie te metody dają takie same wyniki.
# 1. Węzły. Węzły matematyczne, Math, znajdują się w sekcji Math biblioteki. Sekcja ta jest dodatkowo podzielona na podsekcje Functions, Logic i Operators.
# 2. Język Python.
# 3. Węzeł Code Block. Kliknij dwukrotnie w dowolnym miejscu w obszarze rysunku, aby utworzyć węzeł Code Block. Składnia każdej funkcji jest zgodna z nazwą węzła w dodatku Dynamo.
# ** Uwaga: można dopasować rozdzielczość podglądu geometrii za pomocą ustawień dokładności renderowania: Dynamo -> Preferencje -> Ustawienia wizualne -> Dokładność renderowania
# note: Więcej informacji na temat tego przykładu:
# http://dynamobim.org/math-transit/

# group: Łuk
# note: Utwórz łuk, używając 2 oddzielnych metod: przy użyciu węzłów i przy użyciu węzłów Code Block. Wyniki są wizualizowane w celu zapewnienia przejrzystości

# group: Wskazówka
# Wyróżnianie węzłów geometrii
# note: Wskazówka: Wybranie węzła, który rysuje geometrię, zmieni tworzoną geometrię na kolor błękitny. Ten blok kodu rysuje osie wykresu, punkty wzdłuż krzywej, a następnie samą krzywą. Wybierz blok kodu, aby zobaczyć w tle, która krzywa będzie rysowana.

# group: Krzywa cosinusoidalna
# note: W tym zestawie przykładów pokazano, jak wykreślić funkcję cosinus za pomocą węzłów i węzła Code Block.
# W każdym przykładzie jest używana seria liczb jako wartości x dla serii punktów, obliczane są wartości y na podstawie wartości x, a następnie rysowana jest linia w kształcie krzywej cosinusoidalnej. Duży węzeł Code Block na końcu każdego wykresu przesuwa narysowaną geometrię do innej części ekranu, tak aby nie nakładały się one na siebie.

# group: Wskazówka
# Dokładność renderowania
# note: Wskazówka: można dostosować stopień dokładności renderowania geometrii w podglądzie tła, przechodząc do obszaru Dynamo -> Preferencje -> Ustawienia wizualne -> Dokładność renderowania. Wyższa wartość spowoduje, że powierzchnie zakrzywione będą się wydawały bardziej gładkie, ale ich narysowanie będzie wymagać większej mocy obliczeniowej.

# group: Węzły > Początkowe dane wejściowe dla listy punktów
code_block = CodeBlock { -10..10..#20; }

# group: Węzły > Tworzenie początkowej listy punktów i manipulowanie nią
# note: Tworzy siatkę punktów.
# Należy pamiętać, że zachowanie skratowania jest
# iloczynem wektorowym.
byCoordinates = Point.ByCoordinates(x=code_block, y=code_block, lacing=CrossProduct)
flatten = List.Flatten(list=byCoordinates)
X = Point.X(point=flatten)
Y = Point.Y(point=flatten)

# group: Węzły > Amplituda
# note: Amplituda
number_slider = DoubleSlider(5.51, range=0..10 step 0.1)  # graph input

# group: Węzły > Kwadrat
number = DoubleInput(2)  # graph input
pow = Math.Pow(number=X, power=number)

# group: Węzły > Kwadrat
number_2 = DoubleInput(2)  # graph input
pow_2 = Math.Pow(number=Y, power=number_2)

# group: Węzły > Częstotliwość
# note: Częstotliwość
number_slider_2 = DoubleSlider(1.724, range=0..6 step 0.1)  # graph input

# group: Węzły > Kwadrat
number_3 = DoubleInput(2)  # graph input
pow_3 = Math.Pow(number=number_slider_2, power=number_3)

# group: Węzły > Seria obliczeń matematycznych i manipulacji mająca na celu utworzenie geometrii pofałdowanej ('ripple') za pomocą węzłów
add = pow + pow_2
add_2 = add + pow_3
sqrt = Math.Sqrt(number=add_2)
# note: Kąty w dodatku Dynamo podawane są w stopniach
radiansToDegrees = Math.RadiansToDegrees(radians=sqrt)
sin = Math.Sin(angle=radiansToDegrees)
div = sin / sqrt
mul = number_slider * div

# group: Węzły > Zebranie punktów wynikowych i przygotowanie do renderowania końcowego
byCoordinates_2 = Point.ByCoordinates(x=X, y=Y, z=mul)
# note: Zlicza grupy punktów z początkowej kolekcji punktów (20x20)
count = List.Count(list=byCoordinates)

# group: Węzły > Kolekcja punktów
# note: Dzieli płaską listę na szereg
# list według wierszy
chop = List.Chop(list=byCoordinates_2, lengths=count)

# group: Węzły > Sieć krzywych
# note: Tworzy krzywe NURBS
# przez punkty
byPoints = NurbsCurve.ByPoints(points=chop)

# group: Węzły > Powierzchnia końcowa
# note: Tworzy powierzchnię
byLoft = Surface.ByLoft(crossSections=byPoints)

# group: Code Block > Początkowe dane wejściowe dla listy punktów
code_block_2 = CodeBlock { -10..10..#20; }

# group: Code Block > Tworzenie początkowej listy punktów i manipulowanie nią
byCoordinates_3 = Point.ByCoordinates(x=code_block_2, y=code_block_2, lacing=CrossProduct)
flatten_2 = List.Flatten(list=byCoordinates_3)
Y_2 = Point.Y(point=flatten_2)
X_2 = Point.X(point=flatten_2)

# group: Code Block > Funkcja pomocnicza do przesuwania geometrii
# note: Przenosi geometrię
code_block_3 = CodeBlock(x=Y_2) { x+60; }

# group: Code Block > Częstotliwość
number_slider_3 = DoubleSlider(1.724, range=0..5 step 0.1)  # graph input

# group: Code Block > Amplituda
number_slider_4 = DoubleSlider(5.51, range=0..10 step 0.1)  # graph input

# group: Code Block > Seria obliczeń matematycznych i manipulacji mająca na celu utworzenie geometrii pofałdowanej ('ripple') za pomocą języka Python
# note: Nazwy dla metod matematycznych są zgodne z nazwami węzłów dodatku Dynamo użytych w pierwszym przykładzie.
code_block_4 = CodeBlock(x=X_2, y=Y_2, c=number_slider_3, A=number_slider_4)
# ---------- code_block_4.designscript (6 lines) ----------
sum = Math.Pow(x,2) + Math.Pow(y,2) + Math.Pow(c,2);

num1 = Math.Sqrt(sum);
num2 = Math.Sin( Math.RadiansToDegrees(num1) );

A * num2 / num1;
# ----------------------------------------

# group: Code Block > Zebranie punktów wynikowych i przygotowanie do renderowania końcowego
byCoordinates_4 = Point.ByCoordinates(x=code_block_3, y=X_2, z=code_block_4.out3)
count_2 = List.Count(list=byCoordinates_3)

# group: Code Block > Kolekcja punktów
chop_2 = List.Chop(list=byCoordinates_4, lengths=count_2)

# group: Code Block > Sieć krzywych
byPoints_2 = NurbsCurve.ByPoints(points=chop_2)

# group: Code Block > Powierzchnia końcowa
byLoft_2 = Surface.ByLoft(crossSections=byPoints_2)

# group: Python > Początkowe dane wejściowe dla listy punktów
code_block_5 = CodeBlock { -10..10..#20; }

# group: Python > Tworzenie początkowej listy punktów i manipulowanie nią
byCoordinates_5 = Point.ByCoordinates(x=code_block_5, y=code_block_5, lacing=CrossProduct)
flatten_3 = List.Flatten(list=byCoordinates_5)
X_3 = Point.X(point=flatten_3)
Y_3 = Point.Y(point=flatten_3)

# group: Python > Funkcja pomocnicza do przesuwania geometrii
# note: Przenosi geometrię
code_block_6 = CodeBlock(x=X_3) { x+30; }

# group: Python > Amplituda
number_slider_5 = DoubleSlider(5.51, range=0..10 step 0.1)  # graph input

# group: Python > Częstotliwość
number_slider_6 = DoubleSlider(1.724, range=0..5 step 0.1)  # graph input

# group: Python > Seria obliczeń matematycznych i manipulacji mająca na celu utworzenie geometrii pofałdowanej ('ripple') za pomocą języka Python
python_script = Python(Amplitude=number_slider_5, X=X_3, Y=Y_3, Frequency=number_slider_6)  # PythonNet3
# ---------- python_script.python (27 lines) ----------
import clr
clr.AddReference('ProtoGeometry')
from Autodesk.DesignScript.Geometry import *

import math

# The inputs to this node will be stored as a list in the IN variable.
amp = IN[0]   # single value
x = IN[1]     # list
y = IN[2]     # list (expect same length as x)
c = IN[3]     # single value

# Declare an empty array of z-values
z = []

# Solve the equation for each x and y value
for index in range(len(x)):
	sum = math.pow(x[index],2) + math.pow(y[index],2) + math.pow(c,2)
	num1 = math.sqrt(sum)
	num2 = math.sin(num1)
	zVal = amp * num2 / num1
	
	# Append the answer to the list of z values
	z.append(zVal)

# Assign the z-values to the OUT variable
OUT = z
# ----------------------------------------

# group: Python > Zebranie punktów wynikowych i przygotowanie do renderowania końcowego
byCoordinates_6 = Point.ByCoordinates(x=code_block_6, y=Y_3, z=python_script)
count_3 = List.Count(list=byCoordinates_5)

# group: Python > Kolekcja punktów
chop_3 = List.Chop(list=byCoordinates_6, lengths=count_3)

# group: Python > Sieć krzywych
byPoints_3 = NurbsCurve.ByPoints(points=chop_3)

# group: Python > Powierzchnia końcowa
byLoft_3 = Surface.ByLoft(crossSections=byPoints_3)

# group: Krzywa cosinusoidalna przy użyciu węzłów Code Block > Dane wejściowe
# note: Punkt współrzędnej bazowej
code_block_7 = CodeBlock { 25; 20; }
# note: Szereg wartości X
code_block_8 = CodeBlock { 0..10..#20; }
# note: Amplituda
number_slider_7 = DoubleSlider(3, range=0..10 step 0.1)  # graph input
# note: Częstotliwość
number_slider_8 = DoubleSlider(36, range=0..100 step 0.1)  # graph input

# group: Krzywa cosinusoidalna przy użyciu węzłów Code Block > Funkcja krzywej cosinusoidalnej
# Pobierz wartość cosinusa dla danej częstotliwości i kąta, pomnóż ją przez amplitudę
code_block_9 = CodeBlock(amplitude=number_slider_7, frequency=number_slider_8, angle=code_block_8) { amplitude * Math.Cos(frequency * angle); }

# group: Krzywa cosinusoidalna przy użyciu węzłów Code Block > Operacje pośrednie
byCoordinates_7 = Point.ByCoordinates(x=code_block_7.out0, y=code_block_7.out1)
byCoordinates_8 = Point.ByCoordinates(x=code_block_8, y=code_block_9)

# group: Krzywa cosinusoidalna przy użyciu węzłów Code Block > Utwórz i zwizualizuj krzywą cosinusoidalną
code_block_10 = CodeBlock(base=byCoordinates_7, pts=byCoordinates_8)
# ---------- code_block_10.designscript (14 lines) ----------
// Make axes from base point
dimension = 10;
top = Point.ByCoordinates(base.X, base.Y + dimension/2);
bottom = Point.ByCoordinates(base.X, base.Y - dimension/2);
right = Point.ByCoordinates(base.X + 10, base.Y);
Line.ByStartPointEndPoint(bottom, top);
Line.ByStartPointEndPoint(base, right);

// Move function results to base point
vec = base.AsVector();
newPts = pts.Add(vec);

// Draw a line through the points
NurbsCurve.ByPoints(newPts);
# ----------------------------------------

# group: Krzywa cosinusoidalna przy użyciu węzłów > Dane wejściowe
# note: Współrzędne x,y punktu bazowego
code_block_11 = CodeBlock { -5; 20; }
# note: Szereg wartości X
code_block_12 = CodeBlock { 0..10..#20; }
# note: Częstotliwość
number_slider_9 = DoubleSlider(36, range=0..100 step 0.1)  # graph input

# group: Krzywa cosinusoidalna przy użyciu węzłów > Steruje amplitudą
# note: Amplituda
number_slider_10 = DoubleSlider(3, range=0..10 step 0.1)  # graph input

# group: Krzywa cosinusoidalna przy użyciu węzłów
mul_2 = number_slider_9 * code_block_12

# group: Krzywa cosinusoidalna przy użyciu węzłów > Funkcja Math.Cos
# Pobierz wartość cosinusa dla każdej liczby początkowej
cos = Math.Cos(angle=mul_2)

# group (continued): Krzywa cosinusoidalna przy użyciu węzłów
mul_3 = number_slider_10 * cos

# group: Krzywa cosinusoidalna przy użyciu węzłów > Operacje pośrednie
byCoordinates_9 = Point.ByCoordinates(x=code_block_11.out0, y=code_block_11.out1)
# note: Wskazówka: Można włączyć lub wyłączyć wyświetlanie podglądu dowolnego węzła tworzącego geometrię. Kliknij prawym przyciskiem myszy i zaznacz lub odznacz pole wyboru „Podgląd”.
byCoordinates_10 = Point.ByCoordinates(x=code_block_12, y=mul_3)

# group: Krzywa cosinusoidalna przy użyciu węzłów > Utwórz i zwizualizuj krzywą cosinusoidalną
code_block_13 = CodeBlock(base=byCoordinates_9, pts=byCoordinates_10)  # same code as code_block_10

# group: Łuk przy użyciu węzłów > Dane wejściowe
# Utwórz wymagane dane wejściowe:
# 1. Punkt środkowy
# 2. Promień
# 3. Kąt początkowy
# 4. Kąt końcowy
# 5. Wektor normalny (oś Z)
code_block_14 = CodeBlock { 0; 35; }
byCoordinates_11 = Point.ByCoordinates(x=code_block_14.out0, y=code_block_14.out1)
code_block_15 = CodeBlock { 5; 0; }
# note: Przesuń suwak, aby zmienić długość łuku.
number_slider_11 = DoubleSlider(247.821, range=0..360 step 0.1)  # graph input
ZAxis = Vector.ZAxis()

# group: Łuk przy użyciu węzłów > Utwórz łuk na podstawie punktu środkowego, promienia i kąta
# note: Kąty w węzłach lub bloku kodu są podawane w radianach.
byCenterPointRadiusAngle = Arc.ByCenterPointRadiusAngle(center=byCoordinates_11, radius=code_block_15.out0, startAngle=code_block_15.out1, endAngle=number_slider_11, normal=ZAxis)

# group: Łuk przy użyciu węzłów > Wizualizuj dane wyjściowe
endPoint = Curve.EndPoint(curve=byCenterPointRadiusAngle)
byStartPointEndPoint = Line.ByStartPointEndPoint(startPoint=endPoint, endPoint=byCoordinates_11)
startPoint = Curve.StartPoint(curve=byCenterPointRadiusAngle)
byStartPointEndPoint_2 = Line.ByStartPointEndPoint(startPoint=startPoint, endPoint=byCoordinates_11)

# group: Operacje przy użyciu węzłów > -
code_block_16 = CodeBlock { 5; 2; }
sub = code_block_16.out0 - code_block_16.out1
watch = Watch(sub)

# group: Operacje przy użyciu węzłów Code Block > -
code_block_17 = CodeBlock { 5-2; }
watch_2 = Watch(code_block_17)

# group: Operacje przy użyciu węzłów Code Block > %
code_block_18 = CodeBlock { 5%2; }
watch_3 = Watch(code_block_18)

# group: Operacje przy użyciu węzłów > %
code_block_19 = CodeBlock { 5; 2; }
mod = code_block_19.out0 % code_block_19.out1
watch_4 = Watch(mod)

# group: Operacje przy użyciu węzłów Code Block > <=
code_block_20 = CodeBlock { 5<=2; }
watch_5 = Watch(code_block_20)

# group: Operacje przy użyciu węzłów Code Block > >
code_block_21 = CodeBlock { 5>2; }
watch_6 = Watch(code_block_21)

# group: Operacje przy użyciu węzłów > <=
code_block_22 = CodeBlock { 5; 2; }
le = code_block_22.out0 <= code_block_22.out1
watch_7 = Watch(le)

# group: Operacje przy użyciu węzłów > >
code_block_23 = CodeBlock { 5; 2; }
gt = code_block_23.out0 > code_block_23.out1
watch_8 = Watch(gt)

# group: Łuk przy użyciu węzłów Code Block > Dane wejściowe
# Utwórz wymagane dane wejściowe:
# 1. Punkt środkowy
# 2. Kąt końcowy
code_block_24 = CodeBlock { 15; 35; }
byCoordinates_12 = Point.ByCoordinates(x=code_block_24.out0, y=code_block_24.out1)
number_slider_12 = DoubleSlider(126.947, range=0..360 step 0.1)  # graph input

# group: Łuk przy użyciu węzłów Code Block > Utwórz łuk na podstawie punktu środkowego, promienia i kąta
code_block_25 = CodeBlock(center=byCoordinates_12, endAngle=number_slider_12) { Arc.ByCenterPointRadiusAngle(center,5,0,endAngle,Vector.ZAxis()); }

# group: Łuk przy użyciu węzłów Code Block > Wizualizuj dane wyjściowe
startPoint_2 = Curve.StartPoint(curve=code_block_25)
byStartPointEndPoint_3 = Line.ByStartPointEndPoint(startPoint=startPoint_2, endPoint=byCoordinates_12)
endPoint_2 = Curve.EndPoint(curve=code_block_25)
byStartPointEndPoint_4 = Line.ByStartPointEndPoint(startPoint=endPoint_2, endPoint=byCoordinates_12)

# group: Zaokrąglanie przy użyciu węzłów > Dane wejściowe
code_block_26 = CodeBlock { 3.14159; }
code_block_27 = CodeBlock { 3; }

# group: Zaokrąglanie przy użyciu węzłów > Zaokrąglaj w dół
floor = Math.Floor(number=code_block_26)
watch_9 = Watch(floor)

# group: Zaokrąglanie przy użyciu węzłów > Zaokrąglaj w górę
ceiling = Math.Ceiling(number=code_block_26)
watch_10 = Watch(ceiling)

# group: Zaokrąglanie przy użyciu węzłów > Zaokrąglaj w górę lub w dół
# Do najbliższej wartości
round = Math.Round(number=code_block_26)
watch_11 = Watch(round)

# group: Zaokrąglanie przy użyciu węzłów > Zaokrąglaj do określonej liczby cyfr
round_2 = Math.Round(number=code_block_26, digits=code_block_27)
watch_12 = Watch(round_2)

# group: Zaokrąglanie przy użyciu węzłów Code Block > Dane wejściowe
code_block_28 = CodeBlock { 3.14159; }

# group: Zaokrąglanie przy użyciu węzłów Code Block > Zaokrąglaj w dół
code_block_29 = CodeBlock(num=code_block_28) { Math.Floor(num); }
watch_13 = Watch(code_block_29)

# group: Zaokrąglanie przy użyciu węzłów Code Block > Zaokrąglaj w górę
code_block_30 = CodeBlock(num=code_block_28) { Math.Ceiling(num); }
watch_14 = Watch(code_block_30)

# group: Zaokrąglanie przy użyciu węzłów Code Block > Zaokrąglaj w górę lub w dół
# Do najbliższej wartości
code_block_31 = CodeBlock(num=code_block_28) { Math.Round(num); }
watch_15 = Watch(code_block_31)

# group: Zaokrąglanie przy użyciu węzłów Code Block > Zaokrąglaj do określonej liczby cyfr
# Opis <Kliknij dwukrotnie tutaj, aby edytować opis grupy>
code_block_32 = CodeBlock(num=code_block_28) { Math.Round(num,3); }
watch_16 = Watch(code_block_32)

# group: Operacje przy użyciu węzłów Code Block > ==(równa się)
code_block_33 = CodeBlock { true == false; }
watch_17 = Watch(code_block_33)

# group: Operacje przy użyciu węzłów Code Block > Not
code_block_34 = CodeBlock { !true; }
watch_18 = Watch(code_block_34)

# group: Operacje przy użyciu węzłów Code Block > && (oraz)
code_block_35 = CodeBlock { true && false; }
watch_19 = Watch(code_block_35)

# group: Operacje przy użyciu węzłów Code Block > || (lub)
code_block_36 = CodeBlock { true || false; }
watch_20 = Watch(code_block_36)

# group: Operacje przy użyciu węzłów > ==(równa się)
boolean = BoolSelector(true)  # graph input
boolean_2 = BoolSelector(false)  # graph input
eq = boolean == boolean_2
watch_21 = Watch(eq)

# group: Operacje przy użyciu węzłów > || (lub)
boolean_3 = BoolSelector(true)  # graph input
boolean_4 = BoolSelector(false)  # graph input
or_ = boolean_3 || boolean_4
watch_22 = Watch(or_)

# group: Operacje przy użyciu węzłów > && (oraz)
boolean_5 = BoolSelector(true)  # graph input
boolean_6 = BoolSelector(false)  # graph input
and_ = boolean_5 && boolean_6
watch_23 = Watch(and_)

# group: Operacje przy użyciu węzłów > Not
boolean_7 = BoolSelector(true)  # graph input
not_ = Not(x=boolean_7)
watch_24 = Watch(not_)
