# Dynamo graph Core_PassingFunctions.dyn (Dynamo 3.1.0.3411)
# author: Dynamo Team
# Ilustruje przekazywanie funkcji w dodatku Dynamo

# group: Informacje
# note: PRZEKAZYWANIE FUNKCJI
# Dodatek Dynamo jest językiem funkcjonalnym, co oznacza, że DZIAŁANIA mogą być traktowane w taki sam sposób jak OBIEKTY. Większość węzłów w Dynamo można przekształcać w funkcje i używać w bardzo precyzyjny sposób na zbiorze danych.
# Tworzenie funkcji i przekazywanie funkcji działa podobnie jak wydanie polecenia „Biegnij przez 20 minut!” i wskazanie z opóźnieniem osoby, która ma wykonać polecenie.
# W tym przykładzie siatka okręgów jest reprezentowana w złożonej strukturze. Polecenie Wybierz zestaw okręgów jest używane bezpośrednio, a następnie zostaje przekazane jako funkcja na niższe poziomy danych dla uzyskania innego wyniku.

# group: Początkowe dane wejściowe
# Utwórz macierz punktów 5x8
code_block = CodeBlock { 0..#8..4; }
code_block_2 = CodeBlock { 0..#5..4; }
byCoordinates = Point.ByCoordinates(x=code_block, y=code_block_2, lacing=CrossProduct)

# group: Narysuj macierz okręgów
# note: Lista punktów jest zorganizowana w strukturze hierarchicznej — jest to wykaz list. Siatka została utworzona z 8 punktów w kierunku X i 5 w kierunku Y. Lista ta reprezentuje 8 list 5-elementowych lub listy kolumn punktów.
watch = Watch(byCoordinates)
code_block_3 = CodeBlock { 1.5; }
# note: Rysuj okrąg wokół każdego punktu.
byCenterPointRadius = Circle.ByCenterPointRadius(centerPoint=watch, radius=code_block_3)

# group: Wybierz drugą i trzecią LISTĘ
# Przekazywanie funkcji
code_block_4 = CodeBlock { 1..2; }
# note: Z zagnieżdżonej listy okręgów wybierane są elementy {1,2}. Węzły dodatku Dynamo zawsze będą oddziaływać na listę „od zewnętrznej do wewnętrznej” lub od najwyższego poziomu do najniższego.
# Wybranie pozycji 1 i 2 z listy zwróci listę #1 i listę #2 z oryginalnej struktury zagnieżdżonej listy.
getItemAtIndex = List.GetItemAtIndex(list=byCenterPointRadius, index=code_block_4)

# group: Wyciągnij W GÓRĘ
# Walce wynikowe
# note: Wybrane dane nadal istnieją w tej samej strukturze co przed ich selekcją poprzez odwzorowanie.
watch_2 = Watch(getItemAtIndex)
code_block_5 = CodeBlock { 3; }
# note: Ta lista okręgów jest wyciągnięta w górę.
extrude = Curve.Extrude(curve=watch_2, distance=code_block_5)

# group: Wybierz drugi i trzeci ELEMENT z KAŻDEJ LISTY
# Przekazywanie funkcji
code_block_6 = CodeBlock { 1..2; }
# note: Zamiast pobierać dwie pierwsze listy z wyjścia węzła, polecenie List@Level umożliwia pobranie elementu #1 i #2 z KAŻDEJ listy, przez wybranie L2 w porcie wejściowym List.GetItemAtIndex.
# Ta funkcja realizuje funkcjonalność polecenia List.Map, metody używanej do uzyskania dostępu do poziomów wewnętrznych list wejściowych w poprzednich wersjach Dynamo.
getItemAtIndex_2 = List.GetItemAtIndex(list=byCenterPointRadius@L2, index=code_block_6)

# group: Wyciągnij W DÓŁ
# Walce wynikowe
watch_3 = Watch(getItemAtIndex_2)
code_block_7 = CodeBlock { -3; }
# note: Ta lista okręgów jest wyciągnięta w dół.
extrude_2 = Curve.Extrude(curve=watch_3, distance=code_block_7)
