# Dynamo graph Core_Python.dyn (Dynamo 4.1.0.2940)
# author: Dynamo Team
# Używanie węzła w języku Python w dodatku Dynamo

# group: Informacje
# note: PYTHON
# Dodatek Dynamo obsługuje CPython poprzez jeden z dwóch typów węzłów języka Python. (Drugi typ węzła języka Python, niepokazany tutaj, może odczytać skrypt z zewnętrznego pliku do wykonania).
# Kliknij dwukrotnie węzeł języka Python, aby zobaczyć zawarty w nim skrypt.
# Dane wejściowe są zawarte w szyku IN. Dane wyjściowe muszą być przypisane do zmiennej OUT. Wynik może być pojedynczą wartością lub szykiem.

# group: Stosowanie manipulacji znakami do listy przy użyciu węzła w języku Python
# note: W tym przykładzie wszystkie elementy na liście będą dodawane lub odejmowane. Dane wejściowe tego przykładu to liczba, której znak określa, czy przeprowadzane jest dodawanie czy odejmowanie, oraz lista liczb.

# group: Wybierz liczbę dodatnią, 0 lub liczbę ujemną
# Opis <Kliknij dwukrotnie tutaj, aby edytować opis grupy>
# note: Wybierz znak dla operacji
#     liczba< 0      odejmij każdą
#     liczba = 0      0
#     liczba > 0      dodać każdą
integer_slider = IntegerSlider(1, range=-1..2 step 1)

# group: Utwórz listę danych wejściowych
# note: Utwórz dowolną listę
code_block = CodeBlock { 0..10; }
watch = Watch(code_block)

# group: Python
# Stosuje manipulację znakiem
# note: Dane wyjściowe z OUT mają postać szyku, w którym pierwszy element jest pojedynczą wartością, a drugi listą wartości. Taka struktura danych została określona w samej definicji języka Python. Określenie szyku umożliwia wysłanie dowolnej liczby danych wyjściowych do wykresu Dynamo.
python_script = Python(Sign=integer_slider, List=watch)  # PythonNet3
# ---------- python_script.python (31 lines) ----------
# Python script to find add or subtract a series of numbers. 

# Boiler-plate import statments included out-of-the-box
import clr
clr.AddReference('ProtoGeometry')
from Autodesk.DesignScript.Geometry import *

# The inputs to this node will be stored as a list in the IN variable.
sign = IN[0]  # -1 for subtract all, 0 for do nothing, 1 for add all
nums = IN[1]  # List of numbers to subtract or add

partials = [] # Empty array to contain partial sums or differences
result = 0    # Initialize the sum or difference to 0

# Loop through each item and add it or subtract it from the result.
for index in range(len(nums)):
	if sign > 0:
		result = result + nums[index]
		partials.append(result)
	elif sign == 0:
		partials.append(result)
		continue
	else:
		result = result - nums[index]
		partials.append(result)

# Assign the output to the OUT variable
#OUT = results  # Use this to output only the result.
OUT = []
OUT.append(result)
OUT.append(partials)
# ----------------------------------------

# group: Lista wynikowa
code_block_2 = CodeBlock { 1; }
getItemAtIndex = List.GetItemAtIndex(list=python_script, index=code_block_2)
# note: Szereg częściowych wyników.
watch_2 = Watch(getItemAtIndex)

# group: Suma wynikowa
code_block_3 = CodeBlock { 0; }
getItemAtIndex_2 = List.GetItemAtIndex(list=python_script, index=code_block_3)
# note: Łączny wynik.
watch_3 = Watch(getItemAtIndex_2)

# group: Tworzenie geometrii za pomocą języka Python
# note: W tym przykładzie w języku Python nie ma danych wejściowych. Pokazano w nim, jak tworzyć geometrię z wykorzystaniem biblioteki protogeometrii Dynamo. Ponieważ węzeł w języku Python tworzy widoczną geometrię, wybranie go, tak jak w przypadku każdego innego węzła, powoduje podświetlenie geometrii.
python_script_2 = Python()  # PythonNet3
# ---------- python_script_2.python (24 lines) ----------
import clr
clr.AddReference('ProtoGeometry')
from Autodesk.DesignScript.Geometry import *
#The inputs to this node will be stored as a list in the IN variable.
dataEnteringNode = IN

p1 = Point.ByCoordinates(0, 0, 0);
p2 = Point.ByCoordinates(-10, -10, -10);

l = Line.ByStartPointEndPoint(p1, p2);

pts = [
	Point.ByCoordinates(0, 0, 0),
	Point.ByCoordinates(10, 10, 0),
	Point.ByCoordinates(20, 0, 0),
	Point.ByCoordinates(30, 10, 0),
	Point.ByCoordinates(40, 0, 0) ]
	
spline = NurbsCurve.ByPoints(pts)

surf = spline.Extrude(Vector.ByCoordinates(0, 0, 1), 10)

#Assign your output to the OUT variable
OUT = [l, spline, surf]
# ----------------------------------------

# group: Przejrzyj wynikowe dane wyjściowe
# note: Wskazówka: użyj bloku kodu, aby uzyskać
# dostęp do niektórych elementów na liście.
code_block_4 = CodeBlock(output=python_script_2) { output[0]; output[1]; output[2]; }
watch_4 = Watch(code_block_4.out2)
watch_5 = Watch(code_block_4.out0)
watch_6 = Watch(code_block_4.out1)
