# Dynamo graph Core_RangeSyntax.dyn (Dynamo 3.0.0.6964)
# author: Dynamo Team
# Ten wykres zapewnia kilka sposobów generowania serii liczb lub znaków o równych odstępach.

# group: Informacje
# note: Składnia zakresu (Range)
# Istnieje kilka sposobów tworzenia list sekwencji liczb lub znaków.
# Sekwencje są przydatne podczas tworzenia tablic elementów, wykonywania iteracji oraz w ramach przygotowań do użycia różnych funkcji i równań.

# group: Używanie węzła Code Block
# note: start (początek)..end (koniec)..step (krok)
# Od 0 do 10 z krokiem 2
# Ta metoda odpowiada używaniu węzła Range
code_block = CodeBlock { 0..10..2; }
watch = Watch(code_block)
# note: start (początek)..(end) koniec
# Jeśli nie określono wartości kroku (step), przyjmowana jest wartość 1.
# Ta metoda jest identyczna z używaniem węzła Range
# note: Użyj składni zakresu w węźle Code Block. Dostępnych jest kilka możliwości i można skorzystać z kilku metod, aby wygenerować serię liczb (lub znaków):
#         start (początek)..end (koniec)..step (krok)
#         start (początek)..end (koniec)..#amount (liczba)
#         start (początek)..#amount (liczba)..interval (odstęp)
# start = liczba/znak rozpoczynający serię
# end = liczba/znak kończący serię
# step = różnica między dwoma kolejnymi liczbami/znakami
# amount = ile liczb/znaków jest w serii
code_block_2 = CodeBlock { 0..10; }
watch_2 = Watch(code_block_2)
# note: start (początek)..end (koniec)..#amount (liczba)
# Od 0 do 10 w 3 krokach
code_block_3 = CodeBlock { 0..10..#3; }
watch_3 = Watch(code_block_3)
# note: start (początek)..#amount (liczba)..interval (odstęp)
# 10 kroków od 0, każdy krok o wartości 3
# Ta metoda odpowiada używaniu węzła Sequence
code_block_4 = CodeBlock { 0..#10..3; }
watch_4 = Watch(code_block_4)

# group: Użyj węzła Code Block z dynamicznymi danymi wejściowymi
integer_slider = IntegerSlider(7, range=0..10 step 1)
# note: Zastąp wartość zmienną i użyj suwaka, aby dynamicznie sterować długością listy.
code_block_5 = CodeBlock(howMany=integer_slider) { 0..#howMany..3; }
watch_5 = Watch(code_block_5)

# group: Używanie węzła Sequence
number = DoubleInput(0)
number_slider = DoubleSlider(8, range=0..10 step 0.1)
number_2 = DoubleInput(2)
# note: Użyj węzła Sequence, jeśli znane są liczba elementów na liście i długość każdego kroku. Ostatni wynik na liście nie jest wstępnie zdefiniowany, lecz obliczany na podstawie innych danych wejściowych.
# Przykład: projektowanie parkingu z miejscami na 8 samochodów oraz znaną szerokością każdego miejsca parkingowego. Całkowita szerokość wszystkich miejsc parkingowych zależy od poszczególnych szerokości i liczby miejsc.
sequence = Sequence(start=number, amount=number_slider, step=number_2, lacing=Longest)
watch_6 = Watch(sequence)

# group: Używanie węzła Range
number_3 = DoubleInput(0)
number_4 = DoubleInput(10)
number_slider_2 = DoubleSlider(1.75, range=0..10 step 0.1)
# note: Użyj węzła Range, jeśli znany jest początek i koniec sekwencji. Liczba elementów na liście wynikowej nie jest wstępnie zdefiniowana, lecz obliczana na podstawie innych danych wejściowych.
# Warto zauważyć, że ostatni element na liście może nie być zgodny z wartością wejściową końca ('end'), jeśli wartość kroku (step) wykracza poza wartość 'end' przy dodawaniu kolejnego kroku.
# Zwiększenie wartości kroku (step) między ustawieniem początku ('start') i końca ('end') może spowodować utworzenie mniejszej liczby elementów i odwrotnie — zmniejszenie kroku spowoduje zwiększenie długości listy.
range = Range(start=number_3, end=number_4, step=number_slider_2, lacing=Longest)
watch_7 = Watch(range)

# group: Używanie węzła Range — z ciągami
string = StringInput("A")
string_2 = StringInput("P")
code_block_6 = CodeBlock { 1; }
# note: Za pomocą węzła Range można też generować sekwencje znaków.
range_2 = Range(start=string, end=string_2, step=code_block_6, lacing=Longest)
watch_8 = Watch(range_2)

# group: Używanie węzła Sequence — z ciągami
string_3 = StringInput("A")
code_block_7 = CodeBlock { 20; }
# note: Użyj węzła Sequence, aby wygenerować serię liter w kolejności alfabetycznej
sequence_2 = Sequence(start=string_3, amount=code_block_7)
watch_9 = Watch(sequence_2)

# note: Użyj sekwencji wartości, aby utworzyć serię punktów
byCoordinates = Point.ByCoordinates(x=code_block_5)
