# Dynamo graph Core_Strings.dyn (Dynamo 3.4.1.7055)
# author: Dynamo Team
# Na tym wykresie przedstawiono operacje, które można wykonać na ciągach.

# group: Informacje
# note: CIĄGI
# Ten zestaw przykładów ilustruje pewne operacje, które można wykonać za pomocą ciągów. Więcej węzłów do operacji na ciągach można znaleźć w bibliotece węzłów w kategorii 'String'

byCoordinates = Point.ByCoordinates()
code_block = CodeBlock { 5; }
# note: Utwórz obiekt — okrąg
byCenterPointRadius = Circle.ByCenterPointRadius(centerPoint=byCoordinates, radius=code_block)

# group: Przekształć obiekt w ciąg
# note: Przekształć obiekt w opis w postaci ciągu znaków.
string_from_object = FromObject(obj=byCenterPointRadius)

watch = Watch(string_from_object)

# group: Podziel ciąg za pomocą separatorów
code_block_2 = CodeBlock { "("; ")"; " "; "="; ","; }
# note: Podziel ciąg na fragmenty, określając jeden lub więcej znaków separatorów. Każdy separator może zawierać jeden lub wiele znaków.
split = String.Split(string=watch, separator0=code_block_2.out0, separator1=code_block_2.out1, separator2=code_block_2.out2, separator3=code_block_2.out3, separator4=code_block_2.out4)

watch_2 = Watch(split)

# group: Sprawdź, czy ciąg zawiera podciąg
code_block_3 = CodeBlock { "."; }
# note: Sprawdź, czy ciąg znaków zawiera w sobie inny ciąg.
contains = String.Contains(string=watch_2, searchFor=code_block_3)

watch_3 = Watch(contains)

# group: Utwórz ciąg
# note: Utwórz ciąg za pomocą węzła Code Block — znaczniki "" wyznaczają granice wartości ciągu.
code_block_4 = CodeBlock { "Few things are harder to put up with than a good example."; }

# group: Zmień na WIELKIE LITERY
string = StringInput(" - Mark Twain")
# note: Zmień wielkość liter w ciągu znaków
toUpper = String.ToUpper(string=string)
watch_4 = Watch(toUpper)

# group: Połącz
# note: Łączenie dwóch ciągów ze sobą, aby utworzyły jeden, nazywane jest „konkatenacją” lub w skrócie „konkat”.
concat = String.Concat(string0=code_block_4, string1=watch_4)

watch_5 = Watch(concat)

# group: Zastąp znaki w ciągu
code_block_5 = CodeBlock { "put"; }
code_block_6 = CodeBlock { "come"; }
# note: Zamień wszystkie wystąpienia podciągu na ciąg zastępczy.
replace = String.Replace(string=watch_5, searchFor=code_block_5, replaceWith=code_block_6)

watch_6 = Watch(replace)

# group: Odszukaj podciąg wewnątrz ciągu
code_block_7 = CodeBlock { " to"; }
# note: Znajdź w ciągu miejsce występowania określonego podciągu. Wynik jest indeksem, od którego zaczyna się podciąg.
indexOf = String.IndexOf(string=watch_6, searchFor=code_block_7)
watch_7 = Watch(indexOf)

# group: Długość ciągu
# note: Znajdź łączną liczbę znaków w ciągu.
length = String.Length(string=watch_6)
watch_8 = Watch(length)

# note: Odejmij pierwszą część ciągu od całkowitej długości ciągu
sub = watch_8 - watch_7

# group: Usuń znaki
# note: Usuń określoną liczbę znaków w ciągu.
remove = String.Remove(string=watch_6, startIndex=watch_7, count=sub)

# group: Zlicz wystąpienia
watch_9 = Watch(remove)
code_block_8 = CodeBlock { "ar"; }
# note: Zlicz wystąpienia podciągu wewnątrz ciągu.
countOccurrences = String.CountOccurrences(string=watch_9, searchFor=code_block_8)
watch_10 = Watch(countOccurrences)

# group: Utwórz ciąg
# note: If the string includes a " character, use an escape character \ before " to treat it as a part of the string and not the end of the string.
code_block_9 = CodeBlock { "There is no \"I\" in Team"; }
watch_11 = Watch(code_block_9)

zakres_liczb = CodeBlock { 2..101; }

# group: Połącz ciągi za pomocą operacji 'Add'
code_block_10 = CodeBlock { " Dalmatians"; }
# note: Operacja 'Add' automatycznie przekształca liczby w ciągi i łączy je
add = zakres_liczb + code_block_10
watch_12 = Watch(add)

# group: Przekształć obiekt w ciąg
# note: W niektórych sytuacjach należy najpierw przekształcić obiekt w ciąg znaków
string_from_object_2 = FromObject(object=zakres_liczb)
watch_13 = Watch(string_from_object_2)
type = Object.Type(object=string_from_object_2)
watch_14 = Watch(type)

# group: Przekształć ciąg w liczbę
code_block_11 = CodeBlock { "101 Dalmatians"; }
code_block_12 = CodeBlock { " "; }
# note: Podziel ciąg na wyrazy, używając spacji jako separatora
split_2 = String.Split(string=code_block_11, separator0=code_block_12)
# note: Pobierz pierwszy element z listy
firstItem = List.FirstItem(list=split_2)
# note: Przekształć ciąg w liczbę
toNumber = String.ToNumber(string=firstItem)
watch_15 = Watch(toNumber)
type_2 = Object.Type(object=toNumber)
watch_16 = Watch(type_2)

# group: Przekształć ciągi w liczby
# note: Użyj listy wartości logicznych jako maski dla filtru, aby pobrać wszystkie liczby z listy
filterByBoolMask = List.FilterByBoolMask(list=watch_2, mask=contains)
# note: Przekształć ciągi w liczby
toNumber_2 = String.ToNumber(string=filterByBoolMask.in)

watch_17 = Watch(filterByBoolMask.in)
