# Dynamo graph Geometry_Curves.dyn (Dynamo 3.1.0.3411)
# author: Dynamo Team
# Przykładowy wykres ilustrujący sposób tworzenia podstawowych prymitywów krzywych — linii, krzywej PolyCurve oraz otwartej i zamkniętej krzywej Nurbs

# group: Informacje
# note: Ten wykres ilustruje sposób tworzenia podstawowych prymitywów krzywych — linii, krzywej PolyCurve oraz otwartej i zamkniętej krzywej Nurbs

# group: Początkowe dane wejściowe
number = DoubleInput(5)
number_2 = DoubleInput(10)
number_3 = DoubleInput(15)

# group: Początkowe 4 punkty
byCoordinates = Point.ByCoordinates()
byCoordinates_2 = Point.ByCoordinates(y=number)
byCoordinates_3 = Point.ByCoordinates(x=number_2, y=number_2)
byCoordinates_4 = Point.ByCoordinates(x=number_3)

# group: Lista 4 punktów
create = List.Create(item0=byCoordinates, item1=byCoordinates_2, item2=byCoordinates_3, item3=byCoordinates_4)

# group: Krzywa Nurbs
# note: Tworzy krzywą Nurbs na podstawie 4 punktów
byPoints = NurbsCurve.ByPoints(points=create)

# group: Linia
# note: Pojedyncza linia prosta przechodząca przez 2 punkty
byStartPointEndPoint = Line.ByStartPointEndPoint(startPoint=byCoordinates, endPoint=byCoordinates_2)

length = Curve.Length(curve=byStartPointEndPoint)

# group: Krzywa Nurbs — zamknięta
boolean = BoolSelector(true)
# note: Utwórz zamkniętą krzywą Nurbs wewnątrz punktów ograniczających
byControlPoints = NurbsCurve.ByControlPoints(points=create, closeCurve=boolean)

# group: Krzywa PolyCurve
# Opis <Kliknij dwukrotnie tutaj, aby edytować opis grupy>
# note: Utwórz prostą krzywą PolyCurve na podstawie zestawu punktów
# note: Nowa notatka
byPoints_2 = PolyCurve.ByPoints(points=create)

# group: Operacje i zapytania
code_block = CodeBlock { 0..1..#20; }
# note: Krzywe, Polycurves (kolekcje krzywych), obiekty NURBS i linie pochodzą z „krzywych”, a więc na wszystkich z nich można wykonywać wszystkie „operacje” i „zapytania” odnoszące się do krzywych
pointAtParameter = Curve.PointAtParameter(curve=byPoints_2, param=code_block)
