# Dynamo graph Geometry_Points.dyn (Dynamo 3.1.0.3411)
# author: Dynamo Team
# Utwórz tablicę punktów

# group: Początkowe dane wejściowe
number_slider = DoubleSlider(6.4, range=0..10 step 0.1)

# group: Pojedynczy punkt
# note: Podstawowe elementy geometryczne mają wartości domyślne dla wejściowych danych liczbowych. Sprawdź wartości domyślne, umieszczając kursor na porcie wejściowym węzła
byCoordinates = Point.ByCoordinates(z=number_slider)

# group: Podgląd wyników
# note: Po naciśnięciu przycisku „Uruchom” lub przy włączonej opcji uruchamiania automatycznego element geometryczny będzie wyświetlany w podglądzie tła, w węźle Watch 3D lub jako dane w węźle Watch. Elementy zostaną wyróżnione w tle po wybraniu węzła
watch_3d = Watch3D(byCoordinates)

# group: Początkowe dane wejściowe
number = DoubleInput(0)
number_2 = DoubleInput(10)
number_3 = DoubleInput(1)

# group: Zakres liczb
# note: Szyki geometrii mogą być tworzone za pomocą sekwencji, zakresów i list
range = Range(start=number, end=number_2, step=number_3, lacing=Longest)

# group: Macierz punktów
# note: Utwórz tablice 1-, 2- i 3-wymiarowe, przekazując zakresy do portów x, y i z punktów, a następnie zmieniając właściwości skratowania w menu wyświetlanym po kliknięciu węzła prawym przyciskiem myszy. Obserwuj wynik po wybraniu jako opcji skratowania iloczynu wektorowego
byCoordinates_2 = Point.ByCoordinates(x=range, y=range, lacing=CrossProduct)

watch = Watch(byCoordinates)

# group: Zmień punkt w wektor
# Opis <Kliknij dwukrotnie tutaj, aby edytować opis grupy>
# note: Niektóre elementy można łatwo przekształcić w inne
asVector = Point.AsVector(point=watch)

# group: Przesuń macierz o punkt jako wektor
# note: Elementy pochodne mogą być tworzone za pomocą narzędzi w podkategorii Operacje danego elementu
add = Point.Add(point=byCoordinates_2, vectorToAdd=asVector)

# group: Wyświetl podgląd współrzędnej 'Z' punktu
# note: Informacje można wyodrębnić z geometrii za pomocą węzłów w z podkategorii zapytań (Query) dla każdej grupy węzłów (obok symbolu znaku zapytania)
Z = Point.Z(point=byCoordinates)
