# Dynamo graph Geometry_Solids.dyn (Dynamo 3.1.0.3411)
# author: Dynamo Team
# Przykładowy wykres dodatku Dynamo przedstawiający tworzenie brył przy użyciu wyciągnięcia złożonego i manipulacji bryłami (dodawania i odejmowania)

# group: Punkty początkowe dla pierwszej grupy krzywych
byCoordinates = Point.ByCoordinates()
number = DoubleInput(10)
byCoordinates_2 = Point.ByCoordinates(x=number)
byCoordinates_3 = Point.ByCoordinates(y=number)

# group: Dodatkowy punkt dla drugiej grupy krzywych
number_2 = DoubleInput(5)
byCoordinates_4 = Point.ByCoordinates(z=number_2)

# group: Utwórz krzywe początkowe dla podstawy dolnej
byStartPointEndPoint = Line.ByStartPointEndPoint(startPoint=byCoordinates, endPoint=byCoordinates_2)
byThreePoints = Arc.ByThreePoints(firstPoint=byCoordinates, secondPoint=byCoordinates_4, thirdPoint=byCoordinates_2)

# group: Utwórz podstawę dolną
create = List.Create(item0=byStartPointEndPoint, item1=byThreePoints)
byJoinedCurves = PolyCurve.ByJoinedCurves(curves=create)

# group: Dodatkowy punkt dla trzeciej grupy krzywych
number_3 = DoubleInput(15)
byCoordinates_5 = Point.ByCoordinates(x=number_3, y=number_3)

# group: Dodatkowy punkt dla czwartej grupy krzywych
number_4 = DoubleInput(5)
number_5 = DoubleInput(10)
byCoordinates_6 = Point.ByCoordinates(x=number_4, y=number_5, z=number_5)

# group: Utwórz krzywe początkowe dla podstawy górnej
byStartPointEndPoint_2 = Line.ByStartPointEndPoint(startPoint=byCoordinates_3, endPoint=byCoordinates_5)
byThreePoints_2 = Arc.ByThreePoints(firstPoint=byCoordinates_3, secondPoint=byCoordinates_6, thirdPoint=byCoordinates_5)

# group: Utwórz podstawę górną
create_2 = List.Create(item0=byStartPointEndPoint_2, item1=byThreePoints_2)
byJoinedCurves_2 = PolyCurve.ByJoinedCurves(curves=create_2)

# group: Połącz krzywe bazowe w listę
create_3 = List.Create(item0=byJoinedCurves, item1=byJoinedCurves_2)

# group: Wyciągnięcie złożone
# note: Dla większości brył istnieje wiele metod tworzenia. Te przykłady przedstawiają zamknięte profile jako bazę, ale polipowierzchnie mogą być zszyte; dostępnych jest wiele prymitywów (powierzchnie, prostopadłościan, stożek itp.)
byLoft = Solid.ByLoft(crossSections=create_3)

# group: Objętość
# note: Można sprawdzić objętość wyciągnięcia złożonego, ilustrując zamknięty charakter geometrii bryły
volume = Solid.Volume(solid=byLoft)

# group: Dodatkowy punkt dla dodatkowej geometrii wyciągnięcia złożonego
number_6 = DoubleInput(-2)
number_7 = DoubleInput(5)
byCoordinates_7 = Point.ByCoordinates(x=number_6, y=number_7)

# group: Połącz punkty w listę
create_4 = List.Create(item0=byCoordinates, item1=byCoordinates_7, item2=byCoordinates_3)

# group: Utwórz dodatkową krzywą bazową
# Opis <Kliknij dwukrotnie tutaj, aby edytować opis grupy>
# note: Tym razem utwórz krzywą Nurbs na podstawie grupy punktów
byPoints = NurbsCurve.ByPoints(points=create_4)

# group: Wyciągnięcie złożone +
# note: Wskazówka: Wyłącz funkcję „Podgląd” w menu węzłów, dostępnym po kliknięciu prawym przyciskiem myszy, aby nie wyświetlać elementów
byLoft_2 = Solid.ByLoft(crossSections=create_3, guideCurves=byPoints)

# group: Geometria +
code_block = CodeBlock { Vector.ByCoordinates(-20,0,0); }
# note: Przesuń geometrię, aby zwizualizować dane wyjściowe
translate = Geometry.Translate(geometry=byLoft_2, direction=code_block)

# group: Przygotuj elementy ('ingredients') na potrzeby przycięcia geometrii bryły
# note: Grubość
code_block_2 = CodeBlock { 0; }
# note: Wskazówka: Wyłącz funkcję „Podgląd” w menu węzłów, dostępnym po kliknięciu prawym przyciskiem myszy, aby nie wyświetlać elementów
thinShell = Solid.ThinShell(solid=byLoft, internalFaceThickness=code_block_2)
code_block_3 = CodeBlock { Vector.ByCoordinates(20,0,0); }
# note: Przesuń geometrię w kierunku X o 20 jednostek
translate_2 = Geometry.Translate(geometry=thinShell, direction=code_block_3)
code_block_4 = CodeBlock { Point.ByCoordinates(0,0,5); }
ZAxis = Vector.ZAxis()
# note: Utwórz płaszczyznę przechodzącą przez bryłę na potrzeby cięcia
byOriginNormal = Plane.ByOriginNormal(origin=code_block_4, normal=ZAxis)
# note: Ten punkt określa, która część bryły zostanie ucięta
code_block_5 = CodeBlock { Point.ByCoordinates(10,10,10); }

# group: Wyciągnięcie złożone -
# note: Geometryczne operacje logiczne (przecięcie, różnica, połączenie itp.) są dostępne w kategorii Geometria.
trim = Geometry.Trim(geometry=translate_2, other=byOriginNormal, pick=code_block_5)
