# Dynamo graph Geometry_Surfaces.dyn (Dynamo 3.1.0.3411)
# Wykres dodatku Dynamo przedstawiający podstawowe sposoby tworzenia powierzchni — wyciągnięcie proste, wyciągnięcie złożone i przeciągnięcie.

# group: Informacje
# note: Wykres dodatku Dynamo przedstawiający podstawowe sposoby tworzenia powierzchni — wyciągnięcie proste, wyciągnięcie złożone i przeciągnięcie

# group: Dane wejściowe
number = DoubleInput(10)
number_2 = DoubleInput(-10)
byCoordinates = Point.ByCoordinates(x=number, y=number_2)
byCoordinates_2 = Point.ByCoordinates(y=number_2)

# group: Linia
byStartPointEndPoint = Line.ByStartPointEndPoint(startPoint=byCoordinates, endPoint=byCoordinates_2)

# group: Dane wejściowe
byCoordinates_3 = Point.ByCoordinates()

# group: Dane wejściowe
number_3 = DoubleInput(5)
byCoordinates_4 = Point.ByCoordinates(z=number_3)

# group: Dane wejściowe
number_4 = DoubleInput(10)
byCoordinates_5 = Point.ByCoordinates(x=number_4)
byCoordinates_6 = Point.ByCoordinates(y=number_4)

# group: Łuk
byThreePoints = Arc.ByThreePoints(firstPoint=byCoordinates_3, secondPoint=byCoordinates_4, thirdPoint=byCoordinates_5)

# group: Wyciągnięcie złożone
create = List.Create(item0=byStartPointEndPoint, item1=byThreePoints)
# note: Za pomocą 2 zestawów krzywych można utworzyć między nimi geometrię wyciągnięcia złożonego ('Loft')
byLoft = Surface.ByLoft(crossSections=create)

# group: Oblicz obszar wyciągnięcia złożonego
area = Surface.Area(surface=byLoft)
watch = Watch(area)

# group: Dane wejściowe
number_5 = DoubleInput(5)
number_6 = DoubleInput(10)
byCoordinates_7 = Point.ByCoordinates(x=number_5, y=number_6, z=number_6)

# group: Dane wejściowe
number_7 = DoubleInput(15)
byCoordinates_8 = Point.ByCoordinates(x=number_7, y=number_7)

# group: Łuk
byThreePoints_2 = Arc.ByThreePoints(firstPoint=byCoordinates_6, secondPoint=byCoordinates_7, thirdPoint=byCoordinates_8)

# group: Dane wejściowe
number_8 = DoubleInput(-5)
number_9 = DoubleInput(5)
byCoordinates_9 = Point.ByCoordinates(x=number_8, y=number_9)

# group: Łuk
byThreePoints_3 = Arc.ByThreePoints(firstPoint=byCoordinates_3, secondPoint=byCoordinates_9, thirdPoint=byCoordinates_6)

# group: Przeciągnięcie
# note: Dla większości powierzchni istnieje wiele metod tworzenia. Powierzchnie, polipowierzchnie (kolekcje powierzchni) i powierzchnie NURBS można tworzyć przez punkty, krzywe, a także z innych powierzchni i brył
bySweep2Rails = Surface.BySweep2Rails(path=byThreePoints_2, guideRail=byThreePoints, profile=byThreePoints_3)

# group: Połącz wyciągnięcie złożone i przeciągnięcie
create_2 = List.Create(item0=byLoft, item1=bySweep2Rails)
# note: Powierzchnie połączone jako polipowierzchnie mogą być oceniane jako pojedynczy element.
byJoinedSurfaces = PolySurface.ByJoinedSurfaces(surfaces=create_2)

# group: Oblicz połączony obszar wyciągnięcia złożonego + przeciągnięcia
area_2 = Surface.Area(surface=byJoinedSurfaces)
watch_2 = Watch(area_2)

# group: Oblicz obszar przeciągnięcia
area_3 = Surface.Area(surface=bySweep2Rails)
watch_3 = Watch(area_3)

# group: Wyodrębnij punkty z powierzchni i użyj ich
code_block = CodeBlock { 0..1..0.1; }
# note: Krawędzie, punkty i inne elementy mogą być tworzone jako pochodne powierzchni za pomocą tak zwanych operacji — właściwych dla tych geometrii
pointAtParameter = Surface.PointAtParameter(surface=bySweep2Rails, u=code_block, v=code_block, lacing=CrossProduct)
# note: Utwórz nową powierzchnię Nurbs na podstawie wyodrębnionych parametrów (punktów).
# Ukryj pozostałe geometrie, aby obserwować wynik poniżej.
byControlPoints = NurbsSurface.ByControlPoints(controlVertices=pointAtParameter)
watch_3d = Watch3D(byControlPoints)

# group: Wyciągnięcie proste
code_block_2 = CodeBlock { 10; }
# note: Podstawowe wyciągnięcie proste na podstawie podanej krzywej
extrude = Curve.Extrude(curve=byThreePoints_2, distance=code_block_2)
