# Dynamo graph ImportExport_CSV to Stuff.dyn (Dynamo 3.1.0.3411)
# author: Dynamo Team
# Utwórz geometrię na podstawie przeanalizowanych danych z pliku csv

# group: Początkowe dane wejściowe helix.csv
# note: Przejdź do pliku CSV zawierającego numery
# w przestrzeni współrzędnych x, y i z
file_path = Filename("..\..\Data\helix.csv")

# group: Wczytaj plik
fromPath = FileObject(path=file_path)  # "File.FromPath"
readText = FileSystem.ReadText(file=fromPath)

# group: Przeanalizuj dane z pliku csv
string = StringInput("\n")
# note: Podziel ciąg na
# zawijaniu wierszy<enter>
split = String.Split(string=readText, separator0=string)
string_2 = StringInput(",")
# note: Podziel ciąg na przecinku
split_2 = String.Split(string=split, separator0=string_2)
# note: Pliki CSV dostarczają ciągów znaków, nie zaś liczb
toNumber = String.ToNumber(string=split_2)
# note: Składowe grupy X, Y i Z
transpose = List.Transpose(lists=toNumber)

# group: Utwórz geometrię spiralną ('spiral') na podstawie punktów pobranych z pliku csv
# note: Współrzędna 'X'
firstItem = List.FirstItem(list=transpose)
code_block = CodeBlock { 1; }
# note: Współrzędna 'Y'
getItemAtIndex = List.GetItemAtIndex(list=transpose, index=code_block)
# note: Współrzędna 'Z'
lastItem = List.LastItem(list=transpose)
byCoordinates = Point.ByCoordinates(x=firstItem, y=getItemAtIndex, z=lastItem)

# group: Skaluj w górę
number_slider = DoubleSlider(2.337, range=0..20 step 0.1)
# note: Dostosuj ogólny rozkład
# punktów współrzędnych
scale = Geometry.Scale(geometry=byCoordinates, amount=number_slider, lacing=Longest)
