# Dynamo graph ImportExport_Excel to Dynamo.dyn (Dynamo 3.1.0.3411)
# author: Dynamo Team
# Przykładowy wykres ilustrujący importowanie danych z pliku programu Excel do dodatku Dynamo.

# group: Początkowe dane wejściowe
# note: Przejdź do ścieżki pliku programu Excel .xlsx, z którego mają zostać wczytane dane.
file_path = Filename("..\..\Data\helix.xlsx")
# note: Pobierz plik ze ścieżki pliku.
fromPath = FileObject(path=file_path)  # "File.FromPath"
# note: Nazwa arkusza w programie Excel zawierającego dane do zaimportowania.
string = StringInput("helix")

# group: Importuj dane programu Excel
# note: Ten węzeł może odczytywać dane z arkusza programu Excel. Odczyta dane ze wszystkich kolumn i wierszy, a dane wynikowe zostaną umieszczone w tablicy podwójnej [][] (macierzy).
importExcel = Data.ImportExcel(file=fromPath, sheetName=string)

# group: Transponuj
# note: Odwróć (transponuj) listę (macierz). Kolumny staną się wierszami, a wiersze — kolumnami.
transpose = List.Transpose(lists=importExcel)

# group: Wyodrębnij współrzędne punktów
number = DoubleInput(0)
# note: Współrzędna X
getItemAtIndex = List.GetItemAtIndex(list=transpose, index=number)
number_2 = DoubleInput(1)
# note: Współrzędna Y
getItemAtIndex_2 = List.GetItemAtIndex(list=transpose, index=number_2)
number_3 = DoubleInput(2)
# note: Współrzędna Z
getItemAtIndex_3 = List.GetItemAtIndex(list=transpose, index=number_3)

# group: Utwórz helisę na podstawie wyodrębnionych danych z programu Excel
byCoordinates = Point.ByCoordinates(x=getItemAtIndex, y=getItemAtIndex_2, z=getItemAtIndex_3, lacing=Longest)
