# Dynamo graph OpenXMLExport_Data To Excel.dyn "OpenXMLExport_Data do programu Excel" (Dynamo 3.0.3.7594)
# author: Dynamo Team
# Przykładowy wykres dodatku Dynamo ilustrujący eksportowanie danych do programu Excel.

# group: Początkowe dane wejściowe
# note: Steruje liczbą punktów. Traktuj tę pozycję jako wysokość ('height') helisy.
number_slider = DoubleSlider(1.7, range=0..5 step 0.1)

# group: Utwórz helisę
# note: Utwórz serię liczb, zaczynając od 0. Przyrost wynosi 10. Liczba punktów jest mnożona przez 360, więc jeśli wartość wejściowa 'numCircles' jest równa 1, wynikiem jest 37 liczb (od 0 do 360) i uzyskujemy pełny obrót helisy.
code_block = CodeBlock(numCircles=number_slider) { 0..(360*numCircles)..10; }
# note: funkcja cosinus
cos = Math.Cos(angle=code_block, lacing=Longest)
# note: funkcja sinus
sin = Math.Sin(angle=code_block, lacing=Longest)
# note: podziel przez 100
code_block_2 = CodeBlock(x=code_block) { x/100; }
# note: Utwórz listę punktów, komponent X to cosinus, Y — sinus, a Z — wartość początkowa podzielona przez 100.
byCoordinates = Point.ByCoordinates(x=cos, y=sin, z=code_block_2, lacing=Longest)
# note: Utwórz strukturę listy na podstawie listy punktów — wynikiem będzie lista zawierająca 3 listy ([][] — tablica podwójna), z których każda będzie zawierać odpowiednio współrzędne X, Y i Z punktu.
code_block_3 = CodeBlock(pt=byCoordinates) { [pt.X,pt.Y,pt.Z]; }

# group: Utwórz dane wejściowe do eksportu
# 1. Ścieżka pliku csv.
# 2. Nazwa arkusza.
# 3. Transponowana lista punktów.
# 4. Początkowy indeks wiersza i kolumny w programie Excel.
# note: Ścieżka pliku xlsx.
file_path = Filename("..\..\Data\icosohedron_points.xlsx")
# note: Nazwa arkusza w programie Excel.
string = StringInput("helix")
# note: Odwróć macierz (transponuj listę). Kolumny staną się wierszami, a wiersze — kolumnami.
transpose = List.Transpose(lists=code_block_3)
# note: Numer kolumny/wiersza, od którego należy rozpocząć rejestrowanie danych w programie Excel
number = DoubleInput(0)

# group: Eksportuj dane do pliku programu Excel
# note: Eksportuje dane do programu Excel
openXMLExportExcel = Data.OpenXMLExportExcel(filePath=file_path, sheetName=string, data=transpose, startRow=number, startColumn=number)
