# Dynamo graph OpenXMLImport_Data From Excel.dyn "OpenXMLImport_Data z programu Excel" (Dynamo 3.1.0.3411)
# author: Dynamo Team
# Przykładowy wykres ilustrujący importowanie danych z pliku programu Excel.

# group: Początkowe dane wejściowe
# 1. Ścieżka pliku programu Excel.
# 2. Nazwa arkusza
file_path = Filename("..\..\Data\helix.xlsx")
string = StringInput("helix")

# group: Wyodrębnia dane z programu Excel
# note: Odczytaj dane z programu Excel
openXMLImportExcel = Data.OpenXMLImportExcel(filePath=file_path, sheetName=string)

# group: Przeanalizuj dane z programu Excel
# Analizowanie danych ('Parsing') to proces manipulowania źródłem danych w sposób pozwalający uczynić je natywnymi dla środowiska w celu ich wykorzystania.
# note: Transponuj listę (odwróć macierz). Kolumny staną się wierszami, a wiersze — kolumnami.
transpose = List.Transpose(lists=openXMLImportExcel)
# note: pierwsza lista
number = DoubleInput(0)
# note: druga lista
number_2 = DoubleInput(1)
# note: trzecia lista
number_3 = DoubleInput(2)

# group: Utwórz helisę
# note: Współrzędna X
getItemAtIndex = List.GetItemAtIndex(list=transpose, index=number)
# note: Współrzędna Y
getItemAtIndex_2 = List.GetItemAtIndex(list=transpose, index=number_2)
# note: Współrzędna Z
getItemAtIndex_3 = List.GetItemAtIndex(list=transpose, index=number_3)
byCoordinates = Point.ByCoordinates(x=getItemAtIndex, y=getItemAtIndex_2, z=getItemAtIndex_3, lacing=Longest)
