# Dynamo graph Basics_Basic01.dyn (Dynamo 2.19.3.6543)
# author: Dynamo Team
# Conectar nós para adicionar dois números

# note: As entradas funcionais básicas, como números e sequências de caracteres, podem ser selecionadas ao procurar ou pesquisar na biblioteca do lado esquerdo da tela.
# As operações executadas em dados, como conversões matemáticas ou geométricas, também são encontradas na biblioteca
# note: O Dynamo é uma linguagem de programação visual.  Assim como outras linguagens, ele funciona ao vincular elementos simples para formar ideias mais complexas
# note: Puxe um conector para fora da porta “>” no nó Number e conecte-o com a porta “Y” no nó + e, em seguida, pressione o botão “Executar” no canto inferior esquerdo do aplicativo.
number = DoubleInput(2)  # graph input
add = number + _  # unwired: y
# note: É possível visualizar os dados clicando no botão Executar no canto inferior direito do aplicativo. Se você ativar o modo de execução “Automático”, o aplicativo será constantemente atualizado.
# É possível visualizar os dados usando um nó Watch ou clicando no pequeno quadrado na parte inferior da maioria dos nós.
watch = Watch(add)
# note: Mais arquivos de amostra podem ser encontrados no menu Ajuda, ou feche este arquivo clicando em "X" na guia para retornar para a página de Boas-vindas
number_2 = DoubleInput(6)  # graph input
