# Dynamo graph Basics_Basic02.dyn (Dynamo 2.19.3.6543)
# author: Dynamo Team
# Criar uma linha conectando dois pontos

# note: Manipule a posição do ponto no ambiente do Dynamo: selecione o nó Point.ByCoordinates e alterne para a visualização do plano de fundo para puxar o ponto ao longo de seus três eixos.
byCoordinates = Point.ByCoordinates()
# note: Os dados geométricos podem ser visualizados como informações textuais ou no espaço 3D
watch = Watch(byCoordinates)
number = DoubleInput(2)  # graph input
# note: Use nós Number Slider ou Integer Slider para inserir dinamicamente um valor dentro de um intervalo especificado. Clique na seta suspensa azul para abrir as configurações de intervalo numérico
number_slider = DoubleSlider(4.43, range=0..10 step 0.1)  # graph input
# note: É possível alternar entre a navegação de Plano de fundo 3D e a navegação de Vista em gráfico com os botões no canto superior direito da tela (tecla de atalho Ctrl + B). Também é possível ativar ou desativar a Visualização do plano de fundo no menu Vista, para o Dynamo e o Revit.
byCoordinates_2 = Point.ByCoordinates(x=number, z=number_slider)
byStartPointEndPoint = Line.ByStartPointEndPoint(startPoint=byCoordinates_2, endPoint=byCoordinates)
# note: Usar o nó Watch 3D para visualizar o elemento 3D isoladamente
watch_3d = Watch3D(byStartPointEndPoint)
