# Dynamo graph Basics_Basic03.dyn (Dynamo 2.19.3.6543)
# author: Dynamo Team
# Criar uma lista simples

# group: Entradas
# note: É possível gerar listas de dados com sequências e intervalos. Essas listas podem ser reorganizadas com muitos outros nós para fins específicos
number = DoubleInput(0)  # graph input
number_2 = DoubleInput(9)  # graph input
number_3 = DoubleInput(1)  # graph input

# note: Criar uma sequência de números, começando no nó Start até End, com um nó Step fornecido
range = Range(start=number, end=number_2, step=number_3, lacing=Longest)
watch = Watch(range)
number_4 = DoubleInput(3)  # graph input
# note: Fatiar a lista em comprimentos de 3
chop = List.Chop(list=range, lengths=number_4)
# note: Visualizar o resultado e observar a estrutura da lista com a ajuda de um nó Watch
watch_2 = Watch(chop)
# note: Obter o último item em uma lista
lastItem = List.LastItem(list=range)
watch_3 = Watch(lastItem)
