# Dynamo graph Core_AttractorPoint.dyn (Dynamo 3.0.0.6964)
# author: Dynamo Team
# Esse gráfico cria uma grade de cilindros, na qual os tamanhos são determinados pela posição de um ponto atrator.

# group: Informações
# note: PONTO ATRATOR
# Um ponto atrator é um ponto de referência (ou elemento) que influencia as características de outros elementos em um sistema. Um ponto atrativo geralmente funciona como um ímã – quanto mais perto o elemento estiver do atrator, mais afetado será pela influência do atrator.
# Neste exemplo, a altura e o diâmetro dos cilindros são determinados pela distância entre cada cilindro e o ponto atrator que se move ao redor. Os cilindros ao redor do ponto atrator são menores que os que estão mais distantes.
# Para visualizar esse comportamento, mova os dois controles deslizantes de número da entrada do ponto atrator.
# Os pontos atratores são uma forma de introduzir um nível de capacidade de resposta e comportamento dinâmico no processo do projeto.

# group: Tamanho da grade de pontos
# note: Use um Code Block para criar uma sequência de números. Neste caso, uma sequência é criada com números de 1 a 50, com n passos, em que cada passo é 5
intervalo_de_números = CodeBlock { 1..50..5; }

# group: Criar uma grade de pontos
# note: Grade de pontos.
# Para criar, passe uma série de números em duas portas – coordenadas X e Y. Clique com o botão direito do mouse no nó e altere a Amarra para “Produto cartesiano”
# note: A treliça do produto cartesiano de um nó combina cada item de uma lista com cada item em listas alternadas, resultando em uma estrutura de listas semelhante a uma grade.
# Quando usada com entradas X e Y do nó 'Point.ByCoordinates', o resultado é uma grade plana de pontos. Se a terceira coordenada Z for usada, o resultado será uma grade de pontos em forma de cubo.
byCoordinates = Point.ByCoordinates(x=intervalo_de_números, y=intervalo_de_números, lacing=CrossProduct)

# group: Aplainar estrutura da lista
# Não é necessária uma estrutura de lista complexa para ações adicionais com os pontos. Aplaine para gerar apenas uma lista.
# note: Aplaine a lista porque a hierarquia das linhas e colunas não é necessária. Compare a entrada para esse nó com a saída – a estrutura de N listas foi alterada para apenas uma lista.
flatten = List.Flatten(list=byCoordinates)

# group: Posição do ponto atrator
number_slider = DoubleSlider(24.6, range=-10..60 step 0.1)  # graph input
number_slider_2 = DoubleSlider(11.50111001, range=-10..60 step 0.1)  # graph input
# note: Ponto atrativo.  Move os controles deslizantes de entrada para ajustar a localização deste ponto.
byCoordinates_2 = Point.ByCoordinates(x=number_slider, y=number_slider_2)

# group: Distância até o atrator
# note: Localiza a distância entre o ponto atrator e cada ponto base dos cilindros
distanceTo = Geometry.DistanceTo(geometry=flatten, other=byCoordinates_2)

# group: Gerar raios e alturas
# note: Fórmula para fazer com que a altura dos cilindros reaja à localização do ponto atrator. Neste exemplo, a altura de cada cilindro é metade da distância até o ponto atrator. Tente uma fórmula diferente.
altura_do_cilindro = CodeBlock(x=distanceTo) { x/2; }
# note: Uma fórmula retorna um valor a ser usado como um raio do cilindro. Quanto maior a distância, maior será o raio de cada cilindro. Tente usar uma fórmula diferente.
raio_do_cilindro = CodeBlock(x=distanceTo) { x/15; }

# group: Pontos de extremidade
# Converter ponto inicial (original) de cada cilindro com uma determinada altura, definida pela fórmula
# note: Vetor para mover o ponto base (original) para cima por um determinado valor
byCoordinates_3 = Vector.ByCoordinates(z=altura_do_cilindro)
# note: Adicione esse novo valor Z (altura) aos pontos de grade originais para obter os pontos superiores dos cilindros.
add = Point.Add(point=flatten, vectorToAdd=byCoordinates_3)

# group: Criar cilindros
# note: Usar um método que cria um cilindro com um determinado ponto inicial e final e um raio especificado
byPointsRadius = Cylinder.ByPointsRadius(startPoint=flatten, endPoint=add, radius=raio_do_cilindro)
