# Dynamo graph Core_CodeBlocks.dyn (Dynamo 3.4.1.7055)
# author: Dynamo Team
# Este gráfico explora vários usos e aplicações de blocos de código

# group: Informações
# note: BLOCOS DE CÓDIGO
# É possível criar blocos de código clicando duas vezes na tela. Também é possível encontrar um bloco de código na biblioteca de nós na categoria Script > Editor.
# Os blocos de código podem conter:
# •   Valores numéricos (números inteiros e números de ponto flutuante)
# •  Sequências de caracteres (texto)
# •  Valores booleanos (True ou False)
# •  Listas [0,1,2]
# •  Expressões (a+3)
# •  Variáveis
# Outros nós podem ser transformados em uma expressão de bloco de código: selecione um ou vários nós e clique com o botão direito do mouse no espaço entre os nós para selecionar “Nó para Code”. Não há equivalente inverso para essa ação – os blocos de código não podem ser automaticamente transformados em nós.

# group: Nós como blocos de código
# note: É possível usar blocos de código para chamar qualquer outro nó na biblioteca. Os nós na biblioteca geralmente são fornecidos em três tipos:
#     Criar:		criar algo
#     Ação:		executar uma ação em algo
#     Consulta:	obter uma propriedade de algo
# 		que já existe
#  Métodos ou nós desses três tipos são tratados de forma diferente quando chamados em um bloco de código.

# group: Criação da geometria
# note: Juntas, essas declarações formam um algoritmo que cria uma curva helicoidal em um ponto base.
code_block = CodeBlock()
# ---------- code_block.designscript (16 lines) ----------
// Basic inputs
base = Point.ByCoordinates(3,3);
coils = 3;
height = 5;
rad = 0.5;

// Make a series of points
numPts = 8*coils + 1;
seq = 0..(coils*360)..#numPts;
x = rad * Math.Cos(seq);
y = rad * Math.Sin(seq);
z = 0..height..#numPts;
pts = Point.ByCoordinates(x + base.X, y + base.Y, z + base.Z);

// Pass a curve through those points
NurbsCurve.ByPoints(pts);
# ----------------------------------------
# note: O algoritmo de hélice é transformado em uma função ao lhe fornecer um nome, especificando as entradas e informado-lhe o que retornar.
code_block_2 = CodeBlock()
# ---------- code_block_2.designscript (13 lines) ----------
def MakeSpring(base,coils,height,rad)
{
// Make a series of points
numPts = 8*coils + 1;
seq = 0..(coils*360)..#numPts;
x = rad * Math.Cos(seq);
y = rad * Math.Sin(seq);
z = 0..height..#numPts;
pts = Point.ByCoordinates(x + base.X, y + base.Y, z + base.Z);

// Return the curve that passes through those points
return = NurbsCurve.ByPoints(pts);
};
# ----------------------------------------
code_block_3 = CodeBlock { 0..6..2; }
code_block_4 = CodeBlock { 10..20..2; }
# note: O algoritmo de hélice é transformado para definir uma função com o nome arbitrário "MakeSpring".  Esta função é chamada para criar diversas molas, com alturas aleatórias, organizadas em uma malha.
# note: cria uma malha
byCoordinates = Point.ByCoordinates(x=code_block_3, y=code_block_4, lacing=CrossProduct)
flatten = List.Flatten(list=byCoordinates)
code_block_5 = CodeBlock { 5; }
count = List.Count(list=flatten)
# note: cria uma série de números aleatórios (dimensionados por 5) para as alturas da mola
randomList = Math.RandomList(amount=count)
code_block_6 = CodeBlock(random=randomList) { random * 5; }
# note: As entradas para chamadas de função podem ser feitas com listas de elementos ou de itens de valor único. Os dados podem ser passados por meio de uma porta ou declarados diretamente, como no caso de "0.5" para o raio de todas as molas.
code_block_7 = CodeBlock(basePoints=flatten, numCoils=code_block_5, height=code_block_6) { MakeSpring(basePoints,numCoils,height,0.5); }

# group: Funções
# note: As funções podem ser definidas diretamente em um nó de bloco de códigos para serem chamadas de outro lugar nesta definição.
# A primeira linha contém a palavra-chave "Def", depois o nome da função e depois as entradas entre parênteses.
# As chaves definem o corpo da função.  Cada linha deve terminar em um ponto e vírgula.
# Retorne um valor com "return =".
code_block_8 = CodeBlock()
# ---------- code_block_8.designscript (11 lines) ----------
/* This is a multi-line comment,
     which continues for mulitple
     lines. */

def FunctionName(input1, input2)
{
// This is a comment
sum = input1 + input2;

return = sum;
};
# ----------------------------------------
code_block_9 = CodeBlock { 1; }
# note: Os nós do bloco de códigos que definem uma função não possuem portas de entrada ou saída porque eles são chamados de outros nós de bloco de códigos.
code_block_10 = CodeBlock { 2; }
# note: Chame a função com outro nó de bloco de códigos no mesmo arquivo fornecendo o mesmo nome e o mesmo número de argumentos.
code_block_11 = CodeBlock(in1=code_block_9, in2=code_block_10) { FunctionName(in1,in2); }
watch = Watch(code_block_11)
code_block_12 = CodeBlock { "cat"; }
code_block_13 = CodeBlock { "dog"; }
# note: O tipo de argumentos de entrada não está especificado na definição de função, portanto, ela irá operar com o que seja que ela receba.
code_block_14 = CodeBlock(in1=code_block_12, in2=code_block_13) { FunctionName(in1,in2); }
watch_2 = Watch(code_block_14)
origin = Point.Origin()
code_block_15 = CodeBlock { 16; }
# note: A chamada de função com entradas que não fazem sentido para aquela função irá fornecer um resultado nulo.
code_block_16 = CodeBlock(in1=origin, in2=code_block_15) { FunctionName(in1,in2); }
watch_3 = Watch(code_block_16)

# group: Valores numéricos
# Compare os nós criados para fins específicos com o bloco de código
# note: Criado para fins específicos
number = DoubleInput(3.14)
resultado = Watch(number)
# note: Bloco de código
code_block_17 = CodeBlock { 3.140; }
watch_4 = Watch(code_block_17)

# group: Valores da sequência de caracteres
# Compare os nós criados para fins específicos com o bloco de código
# note: Criado para fins específicos
string = StringInput("Less is more.")
resultado_2 = Watch(string)
# note: Use aspas “” para fazer uma sequência de caracteres com um nó de bloco de código
code_block_18 = CodeBlock { "Less is more."; }
watch_5 = Watch(code_block_18)
# note: Usar este nó para visualizar o tipo de valor de saída
type = Object.Type(object=code_block_18)
watch_6 = Watch(type)

# group: Expressões
# Executar uma operação de multiplicação usando o nó * criado para fins específicos e usando o bloco de código
number_2 = DoubleInput(3)
number_3 = DoubleInput(5)
# note: Multiplicar dois números usando o nó *
mul = number_2 * number_3
resultado_3 = Watch(mul)
# note: Executar multiplicação usando um bloco de código
code_block_19 = CodeBlock { 3*5; }
watch_7 = Watch(code_block_19)
code_block_20 = CodeBlock { 3; }
code_block_21 = CodeBlock { 5; }
# note: Usar variáveis como entradas para a operação de multiplicação.
code_block_22 = CodeBlock(a=code_block_20, b=code_block_21) { a*b; }
watch_8 = Watch(code_block_22)

# group: Consultar
# Métodos que consultam e retornam uma propriedade de um objeto
# note: Com os blocos de códigos, um usuário tem a flexibilidade para decidir como especificar as entradas.  Aqui estão as diversas maneiras de, por exemplo, criar o mesmo ponto.
code_block_23 = CodeBlock { 10; }
code_block_24 = CodeBlock { -10; }
# note: Método pronto para uso usando o nó Point.ByCoordinates
byCoordinates_2 = Point.ByCoordinates(x=code_block_23, y=code_block_24)
watch_9 = Watch(byCoordinates_2)
# note: O bloco de código usa um método Point.ByCoordinates com três variáveis para X, Y e Z, no qual Z é definido dentro do mesmo bloco de código e separado por um símbolo ';' de ponto e vírgula
code_block_25 = CodeBlock(x=code_block_23, y=code_block_24) { z = 0; Point.ByCoordinates(x,y,z); }
watch_10 = Watch(code_block_25.out1)
code_block_26 = CodeBlock { Point.ByCoordinates(10,0,0); }
# note: um equivalente ao bloco de código do mesmo método. Os métodos de consulta não requerem parênteses
code_block_27 = CodeBlock(pt=code_block_26) { pt.X; }
watch_11 = Watch(code_block_27)
# note: Método de consulta pronto para uso que retorna a coordenada X do ponto
X = Point.X(point=code_block_26)
watch_12 = Watch(X)
# note: Uma fórmula de uso de um valor negativo do mesmo valor numérico aqui é integrada à notação para variáveis de entrada
code_block_28 = CodeBlock(num=code_block_23) { Point.ByCoordinates(num,-num,0); }
watch_13 = Watch(code_block_28)
# note: O bloco de código usa um método Point.ByCoordinates; todas as três variáveis são fornecidas como entrada
code_block_29 = CodeBlock { Point.ByCoordinates(10,-10,0); }
watch_14 = Watch(code_block_29)

# group: Criar
# Métodos que criam geometria, listas, elementos do Revit ou outros objetos
# note: Método pronto para uso de criação de um ponto na origem
origin_2 = Point.Origin()
watch_15 = Watch(origin_2)
# note: Embora esse método não precise de entradas, os parênteses são necessários
code_block_30 = CodeBlock { Point.Origin(); }
watch_16 = Watch(code_block_30)
code_block_31 = CodeBlock { 0; -10; }
# note: Método pronto para uso de criação de um ponto fornecendo coordenadas X e Y
byCoordinates_3 = Point.ByCoordinates(x=code_block_31.out0, y=code_block_31.out1)
watch_17 = Watch(byCoordinates_3)
# note: Usar um Code Block para replicar o comportamento do nó Point.ByCoordinates. Você encontrará o nome do método se passar o mouse sobre o nó original pronto para uso: o método é mencionado na parte inferior da janela de dica de ferramenta.
# As entradas devem ser especificadas na ordem encontrada no nó pronto para uso.
code_block_32 = CodeBlock { Point.ByCoordinates(0,-10); }
watch_18 = Watch(code_block_32)

# group: Ação
# Métodos que executam uma ação em um objeto
origin_3 = Point.Origin()
ZAxis = Vector.ZAxis()
# note: Método pronto para uso de adição de um vetor a um ponto
add = Point.Add(point=origin_3, vectorToAdd=ZAxis)
watch_19 = Watch(add)
origin_4 = Point.Origin()
ZAxis_2 = Vector.ZAxis()
# note: Os métodos de ação são executados em um objeto. Use a notação de ponto após o próprio objeto e especifique o método e todas as entradas encontradas no nó pronto para uso, exceto a primeira (já que a primeira porta de entrada é o próprio objeto, que você já tem)
code_block_33 = CodeBlock(pt=origin_4, vector=ZAxis_2) { pt.Add(vector); }
watch_20 = Watch(code_block_33)

# group: Criar listas
# note: Criar uma lista usando colchetes para definir a lista e vírgulas para separar elementos individuais
code_block_34 = CodeBlock { ["San Francisco","New York","Chicago"]; }
watch_21 = Watch(code_block_34)
# note: Obter itens de uma lista usando a seguinte notação: list [ i ], em que i é o índice do item. Esse método é idêntico ao uso do nó GetItemAtIndex
code_block_35 = CodeBlock(cities=watch_21) { cities[2]; }
watch_22 = Watch(code_block_35)
# note: Várias variáveis são definidas no mesmo bloco de código e, no final, uma lista é criada contendo todas elas.
code_block_36 = CodeBlock()
# ---------- code_block_36.designscript (7 lines) ----------
str0 = "alpha";
str1 = "beta";
str2 = "charlie";
str3 = "delta";
str4 = "echo";
//
[str0,str1,str2,str3,str4];
# ----------------------------------------
watch_23 = Watch(code_block_36.out5)
code_block_37 = CodeBlock(phonetic=watch_23) { phonetic[2..3]; }
watch_24 = Watch(code_block_37)
code_block_38 = CodeBlock { 2; }
getItemAtIndex = List.GetItemAtIndex(list=watch_21, index=code_block_38)
watch_25 = Watch(getItemAtIndex)

# group: Combinar listas e acessar itens de lista
# Descrição <Clique duas vezes aqui para editar a descrição do grupo>
# note: Crie listas aninhadas e obtenha os itens de listas aninhadas.
code_block_39 = CodeBlock()
# ---------- code_block_39.designscript (6 lines) ----------
kitchen = ["table","stove","sink","refrigerator"];
livingRoom = ["sofa","books"];
bedroom = ["bed","dirty clothes"];
bathroom = ["tooth brush"];
//
allMyStuff = [kitchen, livingRoom, bedroom, bathroom];
# ----------------------------------------
watch_26 = Watch(code_block_39.allMyStuff)
# note: Acessar o segundo item dentro da terceira lista (ou, em outras palavras, acessar o item com o índice '1' dentro da lista com o índice '2')
code_block_40 = CodeBlock(list=watch_26) { list[2][1]; }
watch_27 = Watch(code_block_40)

# group: Replicação
# note: É possível usar as guias de replicação para especificar que as listas sejam compostas em treliça como um “produto cartesiano”.
code_block_41 = CodeBlock { x_vals = 0..10; y_vals = -30..-40; }
code_block_42 = CodeBlock(x_vals=code_block_41.x_vals, y_vals=code_block_41.y_vals) { Point.ByCoordinates(x_vals, y_vals); }
code_block_43 = CodeBlock { x_vals = 0..10; y_vals = -15..-25; }
code_block_44 = CodeBlock(x_vals=code_block_43.x_vals, y_vals=code_block_43.y_vals) { Point.ByCoordinates(x_vals<1>, y_vals<2>); }
byCoordinates_4 = Point.ByCoordinates(x=code_block_41.x_vals, y=code_block_41.y_vals)
byCoordinates_5 = Point.ByCoordinates(x=code_block_43.x_vals, y=code_block_43.y_vals, lacing=CrossProduct)
# note: As guias de replicação, que utilizam colchetes, obtêm duas ou três coleções unidimensionais e colocam os elementos em pares
# para gerar uma coleção uni, bi ou tridimensional.
# note: Neste exemplo, há dois valores x e 5 valores y.  As guias de replicações podem especificar que a combinação resultante seja de 2 listas de 5 pontos ou 5 listas de 2 pontos.
code_block_45 = CodeBlock()
# ---------- code_block_45.designscript (5 lines) ----------
x_vals = 0..1;
y_vals = -3..-7;
//
Point.ByCoordinates(x_vals<1>, y_vals<2>);
Point.ByCoordinates(x_vals<2>, y_vals<1>);
# ----------------------------------------
watch_28 = Watch(code_block_45.out2)
watch_29 = Watch(code_block_45.out3)

# group: Booleano
# Compare os nós criados para fins específicos com o bloco de código
# note: Nó de ativação/desativação de booleanos
boolean = BoolSelector(true)
watch_30 = Watch(boolean)
# note: use valores 'true' ou 'false' em um bloco de código para obter o mesmo resultado
code_block_46 = CodeBlock { true; }
watch_31 = Watch(code_block_46)
