# Dynamo graph Core_ListAtLevel.dyn (Dynamo 3.1.0.3411)
# author: Dynamo Team
# Examinamos List@Level e como ele pode ser usado para atingir os mesmos resultados que o nó List.Map. Criamos uma série de painéis para demonstrar como List@Level realmente funciona.

# group: Informações
# note: Para determinar o nível da lista com o qual você deseja trabalhar, veja a parte inferior do balão de visualização ou o nó de inspeção e siga as linhas da notação List@Level de baixo para cima.

# group: Informações
# Informações gerais para usar List@Level
# note: LIST@LEVEL
# List@Level substitui a funcionalidade de List.Map, permitindo que você selecione diretamente o nível de lista com o qual deseja trabalhar.
# note: Para alterar o nível de lista com o qual você está trabalhando, clique na seta ao lado da porta de entrada da lista e ative a opção “Usar níveis".
# Quando List@Level for ativado pela primeira vez em uma porta de entrada, a lista no segundo nível mais profundo (L2) é selecionada para trabalho.

# group: Informações
# Como este gráfico funciona
# note: Queremos criar painéis no interior da grade. Para fazer isso, precisaremos obter os pontos nos índices 1 e 2 de cada lista no nível mais profundo. Isso pode ser facilmente feito usando o recurso List@Level. O agrupamento das listas é mantido ao ativar a opção “Manter a estrutura da lista”. Mas, primeiro, vamos examinar a lista que criamos com Point.ByCoordinates um pouco mais para determinar qual nível da lista queremos usar.

# group: Entradas
# Descrição <Clique duas vezes aqui para editar a descrição do grupo>
code_block = CodeBlock { 0..30..#8; 12..0..#4; }
# note: Neste exemplo, vamos criar uma lista 3D contendo uma série de pontos. Existem 8 listas em L3, e cada lista contém outras 4 listas (L2). Cada uma das 4 listas contém 4 pontos (L1), resultando em um total de 128 pontos.
byCoordinates = Point.ByCoordinates(x=code_block.out0, y=code_block.out1, z=code_block.out1, lacing=CrossProduct)

# group: Substituindo List.Map por List@Level
code_block_2 = CodeBlock { [1,2]; }
# note: Na versão anterior do Dynamo, List.Map é usado para obter os níveis interiores das listas. Apesar de o mesmo resultado poder ser obtido usando List.Map, ele introduz mais nós no espaço de trabalho. Aqui, usamos List@Level para capturar pontos interiores da grade de maneira mais eficaz. Usaremos esses pontos para criar painéis.
# Também usámos a opção “Manter a estrutura da lista” para manter os agrupamentos da lista inicial e impedir a planificação. Se a opção “Manter a estrutura da lista” estiver desativada, será criada uma única NurbsSurface em vez de 8.
getItemAtIndex = List.GetItemAtIndex(list=byCoordinates@@L2, index=code_block_2)
code_block_3 = CodeBlock { [1,2]; }
# note: A lista existe em diferentes níveis, sendo L1 o nível mais baixo. O número total de elementos produzidos por este nó é 64, conforme mostrado na parte inferior direita.
getItemAtIndex_2 = List.GetItemAtIndex(index=code_block_3)  # unwired: list
# note: Abaixo está o List.Map equivalente à aplicação de List@Level que requer nós adicionais
map = List.Map(f_x=getItemAtIndex_2)  # unwired: list
map_2 = List.Map(list=byCoordinates, f_x=map)

# group: Criando a geometria
# note: Com os conjuntos de pontos selecionados, podemos criar painéis.
byPoints = NurbsSurface.ByPoints(points=getItemAtIndex)
byBestFitThroughPoints = Line.ByBestFitThroughPoints(bestFitPoints=getItemAtIndex)

# group: Inspecionando uma lista com List@Level e Count
# note: O nó List.Count retorna o número de elementos que estão presentes em cada lista. Dependendo do nível selecionado, diferentes valores são retornados. Tente alterar o valor de L3 clicando nas setas ao lado dele.
# note: Existem 8 listas em L3, cada uma contendo 4 listas. Portanto, selecionar L3 implementa a função List.Count nas 8 listas, fornecendo oito valores de “4”.
count = List.Count(list=byCoordinates@L3)

# group: Usando “Manter a estrutura da lista”
# note: Este nó retorna o número de elementos que estão presentes em cada lista em L2. Por padrão, os resultados são simplificados em uma lista 1D.
count_2 = List.Count(list=byCoordinates@L2)
# note: Para preservar a estrutura aninhada das listas, selecione a opção “Manter a estrutura da lista”. “@@” indica como manter a estrutura da lista no DesignScript.
count_3 = List.Count(list=byCoordinates@@L2)

# group: Inspecionando uma lista com List@Level e Flatten
# note: Como exemplo adicional, você pode facilmente aplainar a estrutura aninhada nos níveis interiores das listas fazendo uso do recurso List@Level, junto com o nó Flatten. Tente alterar qual nível será aplainado clicando nas setas ao lado do controle giratório List@Level.
# note: Selecionar L3 converte as 8 listas desse nível em uma matriz 1D. Como cada uma das 8 listas contém 4 itens (que também são listas), isso irá aplainar todas as listas em L3 produzindo 8 listas de 16 pontos.
flatten = List.Flatten(list=byCoordinates@L3)
