# Dynamo graph Core_ListLacing.dyn (Dynamo 3.1.0.3411)
# author: Dynamo Team
# Amarra de lista – todos os modos da Amarra de lista são explorados e demonstrados neste gráfico

# group: Informações
# note: TRELIÇA DE LISTA
# Treliça é a lógica que um nó do Dynamo utiliza para coincidir juntos os itens de diferentes listas.  A maioria dos nós de Dynamo permitem escolher como combinar as listas de informação ao definir o "comportamento da treliça".
# Em cada um destes exemplos, existem duas listas de pontos que estão sendo passados para o nó Line.ByStartPointEndPoint.  O nó que cria a linha deve decidir quantas devem ser desenhadas e entre  quais conjuntos de pontos.
# Defina o comportamento da treliça clicando com o botão direito do mouse em um nó que tenha duas ou mais portas de entrada e escolha "Treliça".

# group: Dica
# note: Dica: exiba o índice do item como uma legenda na visualização do plano de fundo para qualquer nó que compreenda a geometria.  Clique com o botão direito do mouse e selecione "Mostrar legendas".

# group: Dica
# note: Dica: um comportamento de treliça do nó é indicado no nó com o pequeno glifo no canto inferior direito.  Se você não visualizar qualquer glifo, o nó não efetua a treliça.

# group: Entradas
# note: Série mais longa (10 elementos)
code_block = CodeBlock { 0..9; }
code_block_2 = CodeBlock { 4; }
# note: Série mais curta (6 elementos)
code_block_3 = CodeBlock { 0..5; }
code_block_4 = CodeBlock { 0..9; }
code_block_5 = CodeBlock { -10; 4; }
code_block_6 = CodeBlock { 0..5; }
code_block_7 = CodeBlock { 0..9; }
code_block_8 = CodeBlock { 10; 4; }
code_block_9 = CodeBlock { 0..5; }

# group: Criar pontos
# Criar 2 conjuntos de pontos para (10 x 6) para usar como entrada para Line.ByStartPointEndPoint
byCoordinates = Point.ByCoordinates(x=code_block, z=code_block_2)
byCoordinates_2 = Point.ByCoordinates(x=code_block_3)

# group: Amarra mais longa
# note: Treliça mais longa
# É desenhada apenas a quantidade de linhas correspondente à quantidade de itens existente na lista de entradas mais longa. Quando o nó não tiver mais pontos na lista mais curta, ele irá criar tantas cópias do último item quantas forem necessárias para que correspondam com os itens finais na lista mais longa.
byStartPointEndPoint = Line.ByStartPointEndPoint(startPoint=byCoordinates, endPoint=byCoordinates_2, lacing=Longest)

# group: Criar pontos
# Criar 2 conjuntos de pontos para (10 x 6) para usar como entrada para Line.ByStartPointEndPoint
byCoordinates_3 = Point.ByCoordinates(x=code_block_4, y=code_block_5.out0, z=code_block_5.out1)
byCoordinates_4 = Point.ByCoordinates(x=code_block_6, y=code_block_5.out0)

# group: Amarra mais curta
# note: Treliça mais curta
# É desenhada apenas a quantidade de linhas correspondente à quantidade de itens existente na lista de entradas mais curta.  Os pontos "remanescentes" na lista são descartados.
byStartPointEndPoint_2 = Line.ByStartPointEndPoint(startPoint=byCoordinates_3, endPoint=byCoordinates_4)

# group: Criar pontos
# Criar 2 conjuntos de pontos para (10 x 6) para usar como entrada para Line.ByStartPointEndPoint
byCoordinates_5 = Point.ByCoordinates(x=code_block_7, y=code_block_8.out0, z=code_block_8.out1)
byCoordinates_6 = Point.ByCoordinates(x=code_block_9, y=code_block_8.out0)

# group: Treliça do produto cartesiano
# note: Treliça do produto cartesiano
# Todas as possíveis combinações de pares são feitas. Para 10 pontos na lista mais longa e 6 na lista mais curta, haverá 10 x 6 = 60 linhas resultantes.
byStartPointEndPoint_3 = Line.ByStartPointEndPoint(startPoint=byCoordinates_5, endPoint=byCoordinates_6, lacing=CrossProduct)
# note: As linhas resultantes serão armazenadas em uma lista aninhada, em 6 listas de 10 linhas ou em 10 listas de 6 linhas, dependendo de qual lista for especificada primeiro.
watch = Watch(byStartPointEndPoint_3)
