# Dynamo graph Core_Math.dyn (Dynamo 3.4.1.7055)
# author: Dynamo Team
# Este é uma exploração extensa das várias funções matemáticas e dos recursos do Dynamo

# group: Informações
# note: MATEMÁTICA
# É possível executar operações matemáticas no Dynamo com nós da biblioteca de matemática e da biblioteca de operadores ou com um Code Block. Veja abaixo como executar diversas operações matemáticas básicas com cada um desses três métodos.

# group: Operadores aritméticos básicos
# note: Operadores aritméticos como
# +, -, *, /, %

# group: Operadores lógicos básicos
# note: Operadores de comparação como
# <, >, <=, >=, !=, ==

# group: Operadores booleanos
# note: Operadores Booleanos
# (localize outros na biblioteca).

# group: Arredondamento
# note: Arredondamento

# group: Funções matemáticas complexas
# 4 exemplos de obtenção do mesmo resultado final usando nós, Python, Fo
# note: Este exemplo mostra quatro maneiras diferentes de abordar o tratamento das funções matemáticas. Cada um destes exemplos começa com uma grade de pontos, calcula as coordenadas z para os pontos e, em seguida, cria uma superfície. Somente o método de cálculo é diferente; todos estes métodos resolvem o mesmo.
# 1. Nós. Os nós matemáticos estão na seção Matemática da biblioteca, que é subdividida em Funções, Lógica e Operadores.
# 2. Python.
# 3. Nó do bloco de código. Clique duas vezes em qualquer lugar na tela para criar um nó de bloco de código. A sintaxe de cada função coincide com o nome do nó no Dynamo.
# ** Observação: É possível ajustar a resolução da visualização da geometria navegando até as configurações de Precisão de renderização: Dynamo -> Preferências -> Configurações visuais -> Precisão de renderização
# note: Para obter mais informações sobre este exemplo:
# http://dynamobim.org/math-transit/

# group: Arco
# note: Criar um arco usando dois métodos separados, uma vez usando nós e outra usando blocos de código. Os resultados são visualizados para obter maior clareza

# group: Dica
# Destacando nós de geometria
# note: Dica: ao selecionar um nó que desenha geometria, a geometria que ele cria ficará em ciano.  Este bloco de código desenha os eixos de um gráfico, pontos ao longo da curva e, a seguir, a própria curva.  Selecione o bloco de código para ver no plano de fundo a curva que ele desenha.

# group: Curva cosseno
# note: Este conjunto de exemplos mostra como criar gráficos de uma função cosseno usando nós e um bloco de código.
# Cada exemplo usa uma série de números como os valores x para uma série de pontos, calcula os valores y dos valores x e, em seguida, desenha uma linha na forma de uma curva cosseno. O bloco de código grande no final de cada gráfico move a geometria desenhada para uma parte diferente da tela para que não sejam todos sobrepostos.

# group: Dica
# Precisão de renderização
# note: Dica: Ajuste com quanta precisão a geometria na visualização de plano de fundo é renderizada navegando para Dynamo -> Preferências -> Configurações visuais -> Precisão de renderização. Um valor mais alto fará com que superfícies curvadas pareçam mais suaves, mas usará mais poder de processamento para desenhar.

# group: Nós > Entrada inicial da lista de pontos
code_block = CodeBlock { -10..10..#20; }

# group: Nós > Criação e manipulação inicial da lista de pontos
# note: Cria uma malha de pontos.
# Observe que o comportamento da treliça é
# “produto cartesiano”.
byCoordinates = Point.ByCoordinates(x=code_block, y=code_block, lacing=CrossProduct)
flatten = List.Flatten(list=byCoordinates)
X = Point.X(point=flatten)
Y = Point.Y(point=flatten)

# group: Nós > Amplitude
# note: Amplitude
number_slider = DoubleSlider(5.51, range=0..10 step 0.1)  # graph input

# group: Nós > Quadrado
number = DoubleInput(2)  # graph input
pow = Math.Pow(number=X, power=number)

# group: Nós > Quadrado
number_2 = DoubleInput(2)  # graph input
pow_2 = Math.Pow(number=Y, power=number_2)

# group: Nós > Frequência
# note: Frequência
number_slider_2 = DoubleSlider(1.724, range=0..6 step 0.1)  # graph input

# group: Nós > Quadrado
number_3 = DoubleInput(2)  # graph input
pow_3 = Math.Pow(number=number_slider_2, power=number_3)

# group: Nós > Série de cálculos matemáticos e manipulações para criar a geometria “ondulada”' usando nós
add = pow + pow_2
add_2 = add + pow_3
sqrt = Math.Sqrt(number=add_2)
# note: Os ângulos no Dynamo estão em graus
radiansToDegrees = Math.RadiansToDegrees(radians=sqrt)
sin = Math.Sin(angle=radiansToDegrees)
div = sin / sqrt
mul = number_slider * div

# group: Nós > Coletar os pontos resultantes e preparar para renderização final
byCoordinates_2 = Point.ByCoordinates(x=X, y=Y, z=mul)
# note: Conta o número de grupos de pontos da coleção inicial de pontos (20x20)
count = List.Count(list=byCoordinates)

# group: Nós > A coleção de pontos
# note: Divide a lista plana em uma série
# de listas por linha
chop = List.Chop(list=byCoordinates_2, lengths=count)

# group: Nós > A rede de curvas
# note: Cria curvas NURBS
# através de pontos
byPoints = NurbsCurve.ByPoints(points=chop)

# group: Nós > A superfície final
# note: Cria uma superfície
byLoft = Surface.ByLoft(crossSections=byPoints)

# group: Bloco de código > Entrada inicial da lista de pontos
code_block_2 = CodeBlock { -10..10..#20; }

# group: Bloco de código > Criação e manipulação inicial da lista de pontos
byCoordinates_3 = Point.ByCoordinates(x=code_block_2, y=code_block_2, lacing=CrossProduct)
flatten_2 = List.Flatten(list=byCoordinates_3)
Y_2 = Point.Y(point=flatten_2)
X_2 = Point.X(point=flatten_2)

# group: Bloco de código > Função auxiliar para mover a geometria
# note: Move a geometria sobre
code_block_3 = CodeBlock(x=Y_2) { x+60; }

# group: Bloco de código > Frequência
number_slider_3 = DoubleSlider(1.724, range=0..5 step 0.1)  # graph input

# group: Bloco de código > Amplitude
number_slider_4 = DoubleSlider(5.51, range=0..10 step 0.1)  # graph input

# group: Bloco de código > Série de cálculos matemáticos e manipulações para criar a geometria “ondulada” usando o Python
# note: Os nomes dos métodos matemáticos correspondem aos nós do Dynamo utilizados no primeiro exemplo.
code_block_4 = CodeBlock(x=X_2, y=Y_2, c=number_slider_3, A=number_slider_4)
# ---------- code_block_4.designscript (6 lines) ----------
sum = Math.Pow(x,2) + Math.Pow(y,2) + Math.Pow(c,2);

num1 = Math.Sqrt(sum);
num2 = Math.Sin( Math.RadiansToDegrees(num1) );

A * num2 / num1;
# ----------------------------------------

# group: Bloco de código > Coletar os pontos resultantes e preparar para renderização final
byCoordinates_4 = Point.ByCoordinates(x=code_block_3, y=X_2, z=code_block_4.out3)
count_2 = List.Count(list=byCoordinates_3)

# group: Bloco de código > A coleção de pontos
chop_2 = List.Chop(list=byCoordinates_4, lengths=count_2)

# group: Bloco de código > A rede de curvas
byPoints_2 = NurbsCurve.ByPoints(points=chop_2)

# group: Bloco de código > A superfície final
byLoft_2 = Surface.ByLoft(crossSections=byPoints_2)

# group: Python > Entrada inicial da lista de pontos
code_block_5 = CodeBlock { -10..10..#20; }

# group: Python > Criação e manipulação inicial da lista de pontos
byCoordinates_5 = Point.ByCoordinates(x=code_block_5, y=code_block_5, lacing=CrossProduct)
flatten_3 = List.Flatten(list=byCoordinates_5)
X_3 = Point.X(point=flatten_3)
Y_3 = Point.Y(point=flatten_3)

# group: Python > Função auxiliar para mover a geometria
# note: Move a geometria sobre
code_block_6 = CodeBlock(x=X_3) { x+30; }

# group: Python > Amplitude
number_slider_5 = DoubleSlider(5.51, range=0..10 step 0.1)  # graph input

# group: Python > Frequência
number_slider_6 = DoubleSlider(1.724, range=0..5 step 0.1)  # graph input

# group: Python > Série de cálculos matemáticos e manipulações para criar a geometria “ondulada” usando o Python
python_script = Python(Amplitude=number_slider_5, X=X_3, Y=Y_3, Frequency=number_slider_6)  # PythonNet3
# ---------- python_script.python (27 lines) ----------
import clr
clr.AddReference('ProtoGeometry')
from Autodesk.DesignScript.Geometry import *

import math

# The inputs to this node will be stored as a list in the IN variable.
amp = IN[0]   # single value
x = IN[1]     # list
y = IN[2]     # list (expect same length as x)
c = IN[3]     # single value

# Declare an empty array of z-values
z = []

# Solve the equation for each x and y value
for index in range(len(x)):
	sum = math.pow(x[index],2) + math.pow(y[index],2) + math.pow(c,2)
	num1 = math.sqrt(sum)
	num2 = math.sin(num1)
	zVal = amp * num2 / num1
	
	# Append the answer to the list of z values
	z.append(zVal)

# Assign the z-values to the OUT variable
OUT = z
# ----------------------------------------

# group: Python > Coletar os pontos resultantes e preparar para renderização final
byCoordinates_6 = Point.ByCoordinates(x=code_block_6, y=Y_3, z=python_script)
count_3 = List.Count(list=byCoordinates_5)

# group: Python > A coleção de pontos
chop_3 = List.Chop(list=byCoordinates_6, lengths=count_3)

# group: Python > A rede de curvas
byPoints_3 = NurbsCurve.ByPoints(points=chop_3)

# group: Python > A superfície final
byLoft_3 = Surface.ByLoft(crossSections=byPoints_3)

# group: Curva cosseno usando blocos de código > Entradas
# note: Ponto base das coordenadas
code_block_7 = CodeBlock { 25; 20; }
# note: Série de valores X
code_block_8 = CodeBlock { 0..10..#20; }
# note: Amplitude
number_slider_7 = DoubleSlider(3, range=0..10 step 0.1)  # graph input
# note: Frequência
number_slider_8 = DoubleSlider(36, range=0..100 step 0.1)  # graph input

# group: Curva cosseno usando blocos de código > Função da curva cosseno
# Obter o valor cosseno para a frequência e o ângulo determinados e multiplicá-lo pela amplitude
code_block_9 = CodeBlock(amplitude=number_slider_7, frequency=number_slider_8, angle=code_block_8) { amplitude * Math.Cos(frequency * angle); }

# group: Curva cosseno usando blocos de código > Operações intermediárias
byCoordinates_7 = Point.ByCoordinates(x=code_block_7.out0, y=code_block_7.out1)
byCoordinates_8 = Point.ByCoordinates(x=code_block_8, y=code_block_9)

# group: Curva cosseno usando blocos de código > Criar e visualizar a curva cosseno
code_block_10 = CodeBlock(base=byCoordinates_7, pts=byCoordinates_8)
# ---------- code_block_10.designscript (14 lines) ----------
// Make axes from base point
dimension = 10;
top = Point.ByCoordinates(base.X, base.Y + dimension/2);
bottom = Point.ByCoordinates(base.X, base.Y - dimension/2);
right = Point.ByCoordinates(base.X + 10, base.Y);
Line.ByStartPointEndPoint(bottom, top);
Line.ByStartPointEndPoint(base, right);

// Move function results to base point
vec = base.AsVector();
newPts = pts.Add(vec);

// Draw a line through the points
NurbsCurve.ByPoints(newPts);
# ----------------------------------------

# group: Curva cosseno usando nós > Entradas
# note: Coordenadas x,y do ponto base
code_block_11 = CodeBlock { -5; 20; }
# note: Série de valores X
code_block_12 = CodeBlock { 0..10..#20; }
# note: Frequência
number_slider_9 = DoubleSlider(36, range=0..100 step 0.1)  # graph input

# group: Curva cosseno usando nós > Controla a amplitude
# note: Amplitude
number_slider_10 = DoubleSlider(3, range=0..10 step 0.1)  # graph input

# group: Curva cosseno usando nós
mul_2 = number_slider_9 * code_block_12

# group: Curva cosseno usando nós > Função Math.Cos
# Obter o valor cosseno de cada número inicial
cos = Math.Cos(angle=mul_2)

# group (continued): Curva cosseno usando nós
mul_3 = number_slider_10 * cos

# group: Curva cosseno usando nós > Operações intermediárias
byCoordinates_9 = Point.ByCoordinates(x=code_block_11.out0, y=code_block_11.out1)
# note: Dica: você pode ativar ou desativar a funcionalidade de visualização para qualquer nó que compreende a geometria.  Clique com o botão direito do mouse e marque ou desmarque "Visualizar".
byCoordinates_10 = Point.ByCoordinates(x=code_block_12, y=mul_3)

# group: Curva cosseno usando nós > Criar e visualizar a curva cosseno
code_block_13 = CodeBlock(base=byCoordinates_9, pts=byCoordinates_10)  # same code as code_block_10

# group: Arco usando nós > Entradas
# Crie as entradas necessárias:
# 1. Ponto central
# 2. Raio
# 3. Ângulo inicial
# 4. Ângulo final
# 5. A normal (eixo Z)
code_block_14 = CodeBlock { 0; 35; }
byCoordinates_11 = Point.ByCoordinates(x=code_block_14.out0, y=code_block_14.out1)
code_block_15 = CodeBlock { 5; 0; }
# note: Mova o controle deslizante para alterar o comprimento do arco.
number_slider_11 = DoubleSlider(247.821, range=0..360 step 0.1)  # graph input
ZAxis = Vector.ZAxis()

# group: Arco usando nós > Criar arco por ponto central, raio e ângulo
# note: Os ângulos dos nós ou do bloco de código estão em radianos.
byCenterPointRadiusAngle = Arc.ByCenterPointRadiusAngle(center=byCoordinates_11, radius=code_block_15.out0, startAngle=code_block_15.out1, endAngle=number_slider_11, normal=ZAxis)

# group: Arco usando nós > Visualizar as saídas
endPoint = Curve.EndPoint(curve=byCenterPointRadiusAngle)
byStartPointEndPoint = Line.ByStartPointEndPoint(startPoint=endPoint, endPoint=byCoordinates_11)
startPoint = Curve.StartPoint(curve=byCenterPointRadiusAngle)
byStartPointEndPoint_2 = Line.ByStartPointEndPoint(startPoint=startPoint, endPoint=byCoordinates_11)

# group: Operações usando nós > -
code_block_16 = CodeBlock { 5; 2; }
sub = code_block_16.out0 - code_block_16.out1
watch = Watch(sub)

# group: Operações usando blocos de código > -
code_block_17 = CodeBlock { 5-2; }
watch_2 = Watch(code_block_17)

# group: Operações usando blocos de código > %
code_block_18 = CodeBlock { 5%2; }
watch_3 = Watch(code_block_18)

# group: Operações usando nós > %
code_block_19 = CodeBlock { 5; 2; }
mod = code_block_19.out0 % code_block_19.out1
watch_4 = Watch(mod)

# group: Operações usando blocos de código > <=
code_block_20 = CodeBlock { 5<=2; }
watch_5 = Watch(code_block_20)

# group: Operações usando blocos de código > >
code_block_21 = CodeBlock { 5>2; }
watch_6 = Watch(code_block_21)

# group: Operações usando nós > <=
code_block_22 = CodeBlock { 5; 2; }
le = code_block_22.out0 <= code_block_22.out1
watch_7 = Watch(le)

# group: Operações usando nós > >
code_block_23 = CodeBlock { 5; 2; }
gt = code_block_23.out0 > code_block_23.out1
watch_8 = Watch(gt)

# group: Arco usando blocos de código > Entradas
# Crie as entradas necessárias:
# 1. Ponto central
# 2. Ângulo final
code_block_24 = CodeBlock { 15; 35; }
byCoordinates_12 = Point.ByCoordinates(x=code_block_24.out0, y=code_block_24.out1)
number_slider_12 = DoubleSlider(126.947, range=0..360 step 0.1)  # graph input

# group: Arco usando blocos de código > Criar arco por ponto central, raio e ângulo
code_block_25 = CodeBlock(center=byCoordinates_12, endAngle=number_slider_12) { Arc.ByCenterPointRadiusAngle(center,5,0,endAngle,Vector.ZAxis()); }

# group: Arco usando blocos de código > Visualizar as saídas
startPoint_2 = Curve.StartPoint(curve=code_block_25)
byStartPointEndPoint_3 = Line.ByStartPointEndPoint(startPoint=startPoint_2, endPoint=byCoordinates_12)
endPoint_2 = Curve.EndPoint(curve=code_block_25)
byStartPointEndPoint_4 = Line.ByStartPointEndPoint(startPoint=endPoint_2, endPoint=byCoordinates_12)

# group: Arredondamento usando nós > Entradas
code_block_26 = CodeBlock { 3.14159; }
code_block_27 = CodeBlock { 3; }

# group: Arredondamento usando nós > Arredondar para baixo
floor = Math.Floor(number=code_block_26)
watch_9 = Watch(floor)

# group: Arredondamento usando nós > Arredondar para cima
ceiling = Math.Ceiling(number=code_block_26)
watch_10 = Watch(ceiling)

# group: Arredondamento usando nós > Arredondar para cima ou para baixo
# O que estiver mais próximo
round = Math.Round(number=code_block_26)
watch_11 = Watch(round)

# group: Arredondamento usando nós > Arredondar para o número de dígitos especificado
round_2 = Math.Round(number=code_block_26, digits=code_block_27)
watch_12 = Watch(round_2)

# group: Arredondamento usando blocos de código > Entradas
code_block_28 = CodeBlock { 3.14159; }

# group: Arredondamento usando blocos de código > Arredondar para baixo
code_block_29 = CodeBlock(num=code_block_28) { Math.Floor(num); }
watch_13 = Watch(code_block_29)

# group: Arredondamento usando blocos de código > Arredondar para cima
code_block_30 = CodeBlock(num=code_block_28) { Math.Ceiling(num); }
watch_14 = Watch(code_block_30)

# group: Arredondamento usando blocos de código > Arredondar para cima ou para baixo
# O que estiver mais próximo
code_block_31 = CodeBlock(num=code_block_28) { Math.Round(num); }
watch_15 = Watch(code_block_31)

# group: Arredondamento usando blocos de código > Arredondar para o número de dígitos especificado
# Descrição <Clique duas vezes aqui para editar a descrição do grupo>
code_block_32 = CodeBlock(num=code_block_28) { Math.Round(num,3); }
watch_16 = Watch(code_block_32)

# group: Operações usando blocos de código > ==(é igual)
code_block_33 = CodeBlock { true == false; }
watch_17 = Watch(code_block_33)

# group: Operações usando blocos de código > Não
code_block_34 = CodeBlock { !true; }
watch_18 = Watch(code_block_34)

# group: Operações usando blocos de código > && (e)
code_block_35 = CodeBlock { true && false; }
watch_19 = Watch(code_block_35)

# group: Operações usando blocos de código > || (ou)
code_block_36 = CodeBlock { true || false; }
watch_20 = Watch(code_block_36)

# group: Operações usando nós > ==(é igual)
boolean = BoolSelector(true)  # graph input
boolean_2 = BoolSelector(false)  # graph input
eq = boolean == boolean_2
watch_21 = Watch(eq)

# group: Operações usando nós > || (ou)
boolean_3 = BoolSelector(true)  # graph input
boolean_4 = BoolSelector(false)  # graph input
or_ = boolean_3 || boolean_4
watch_22 = Watch(or_)

# group: Operações usando nós > && (e)
boolean_5 = BoolSelector(true)  # graph input
boolean_6 = BoolSelector(false)  # graph input
and_ = boolean_5 && boolean_6
watch_23 = Watch(and_)

# group: Operações usando nós > Não
boolean_7 = BoolSelector(true)  # graph input
not_ = Not(x=boolean_7)
watch_24 = Watch(not_)
