# Dynamo graph Core_PassingFunctions.dyn (Dynamo 3.1.0.3411)
# author: Dynamo Team
# Demonstra como passar uma função no Dynamo

# group: Informações
# note: FUNÇÕES DE PASSAGEM
# O Dynamo é uma linguagem funcional, o que significa que as AÇÕES podem ser tratadas da mesma forma que são tratados os OBJETOS.  A maioria dos nós no Dynamo podem ser convertidos em função e usados de uma maneira muito precisa em um conjunto de dados.
# Criar uma função e passar uma função é como dar a ordem "Corra durante 20 minutos!", mas só mais tarde especificar a quem você estava dando a ordem.
# Neste exemplo, um eixo de círculos é representado em uma estrutura complexa.  O comando para selecionar um conjunto de círculos é utilizado diretamente e, depois, o comando é passado como uma função para níveis inferiores de dados para um resultado diferente.

# group: Entradas iniciais
# Criar uma matriz de pontos 5x8
code_block = CodeBlock { 0..#8..4; }
code_block_2 = CodeBlock { 0..#5..4; }
byCoordinates = Point.ByCoordinates(x=code_block, y=code_block_2, lacing=CrossProduct)

# group: Desenhar matriz de círculos
# note: Esta lista de pontos está organizada em uma estrutura hierárquica -- ela é uma lista das listas.  A malha foi composta de 8 pontos na direção X e 5 na direção Y.  Esta lista representa 8 listas de 5 coisas ou listas de colunas de pontos.
watch = Watch(byCoordinates)
code_block_3 = CodeBlock { 1.5; }
# note: Desenhe um círculo ao redor de cada ponto.
byCenterPointRadius = Circle.ByCenterPointRadius(centerPoint=watch, radius=code_block_3)

# group: Selecionar a segunda e a terceira LISTA
# Passando a função
code_block_4 = CodeBlock { 1..2; }
# note: Na lista aninhada de círculos, os itens {1,2} estão selecionados.  Os nós do Dynamo sempre agirão em uma lista "de fora para dentro" ou do nível mais alto para o nível mais baixo.
# Selecionar os itens 1 e 2 na lista irá retornar a lista nº 1 e a lista nº 2 da estrutura original da lista aninhada.
getItemAtIndex = List.GetItemAtIndex(list=byCenterPointRadius, index=code_block_4)

# group: Efetuar extrusão ACIMA
# Cilindros resultantes
# note: Os dados selecionados ainda existem na mesma estrutura que estavam antes que eu os selecionasse pelo mapeamento.
watch_2 = Watch(getItemAtIndex)
code_block_5 = CodeBlock { 3; }
# note: Esta lista de círculos tem sua extrusão para cima aplicada.
extrude = Curve.Extrude(curve=watch_2, distance=code_block_5)

# group: Selecionar o segundo e o terceiro ITEM de CADA LISTA
# Passando a função
code_block_6 = CodeBlock { 1..2; }
# note: Em vez de tomar as duas primeiras listas da saída do nó, o recurso List@Level permite que o item nº 1 e o item nº 2 de CADA lista sejam tomados selecionando L2 na porta de entrada de List.GetItemAtIndex.
# Observe que este recurso corrige a funcionalidade de List.Map, um método usado para acessar os níveis internos das listas de entrada nas versões anteriores do Dynamo.
getItemAtIndex_2 = List.GetItemAtIndex(list=byCenterPointRadius@L2, index=code_block_6)

# group: Efetuar extrusão ABAIXO
# Cilindros resultantes
watch_3 = Watch(getItemAtIndex_2)
code_block_7 = CodeBlock { -3; }
# note: Esta lista de círculos tem sua extrusão para baixo aplicada.
extrude_2 = Curve.Extrude(curve=watch_3, distance=code_block_7)
