# Dynamo graph Core_Python.dyn (Dynamo 4.1.0.2940)
# author: Dynamo Team
# Usar o nó do Python dentro do Dynamo

# group: Informações
# note: PYTHON
# O Dynamo suporta o CPython através de um dos dois tipos de nós Python. (Um segundo tipo de nó Python, não mostrado aqui, pode ler um script em um arquivo externo para ser executado).
# Clique duas vezes no nó do Python para ver o script que ele contém.
# A entrada está contida na matriz IN. O resultado deve ser atribuído à variável OUT. O resultado pode ser um único valor ou uma matriz.

# group: Usar o nó do Python para aplicar manipulação de sinal à lista
# note: Este exemplo irá adicionar ou subtrair todos os itens em uma lista.  Suas entradas são números, cujo sinal determina se a soma ou subtração será usada, e uma lista de números.

# group: Escolher número positivo, 0 ou número negativo
# Descrição <Clique duas vezes aqui para editar a descrição do grupo>
# note: Selecione o sinal para a operação
#     número <0     subtrair cada
#     número = 0    0
#     número > 0    adicionar cada
integer_slider = IntegerSlider(1, range=-1..2 step 1)

# group: Criar lista de entrada
# note: Criar qualquer lista
code_block = CodeBlock { 0..10; }
watch = Watch(code_block)

# group: Python
# Aplica manipulação de sinal
# note: A saída do check-out é uma matriz, onde o primeiro item é um valor único e o segundo item é uma lista de valores.  Esta estrutura de dados foi especificada na própria definição Python.  A especificação de uma matriz permite enviar qualquer número de saídas para o gráfico Dynamo.
python_script = Python(Sign=integer_slider, List=watch)  # PythonNet3
# ---------- python_script.python (31 lines) ----------
# Python script to find add or subtract a series of numbers. 

# Boiler-plate import statments included out-of-the-box
import clr
clr.AddReference('ProtoGeometry')
from Autodesk.DesignScript.Geometry import *

# The inputs to this node will be stored as a list in the IN variable.
sign = IN[0]  # -1 for subtract all, 0 for do nothing, 1 for add all
nums = IN[1]  # List of numbers to subtract or add

partials = [] # Empty array to contain partial sums or differences
result = 0    # Initialize the sum or difference to 0

# Loop through each item and add it or subtract it from the result.
for index in range(len(nums)):
	if sign > 0:
		result = result + nums[index]
		partials.append(result)
	elif sign == 0:
		partials.append(result)
		continue
	else:
		result = result - nums[index]
		partials.append(result)

# Assign the output to the OUT variable
#OUT = results  # Use this to output only the result.
OUT = []
OUT.append(result)
OUT.append(partials)
# ----------------------------------------

# group: Lista resultante
code_block_2 = CodeBlock { 1; }
getItemAtIndex = List.GetItemAtIndex(list=python_script, index=code_block_2)
# note: A série de resultados parciais.
watch_2 = Watch(getItemAtIndex)

# group: Soma resultante
code_block_3 = CodeBlock { 0; }
getItemAtIndex_2 = List.GetItemAtIndex(list=python_script, index=code_block_3)
# note: O resultado total.
watch_3 = Watch(getItemAtIndex_2)

# group: Criação da geometria do Python
# note: Este exemplo Python não tem entradas.  Ele demonstra como criar a geometria usando a biblioteca de protogeometria do Dynamo.  Como o nó Python cria a geometria visível, ao ser selecionada, assim como qualquer outro nó, ela será realçada.
python_script_2 = Python()  # PythonNet3
# ---------- python_script_2.python (24 lines) ----------
import clr
clr.AddReference('ProtoGeometry')
from Autodesk.DesignScript.Geometry import *
#The inputs to this node will be stored as a list in the IN variable.
dataEnteringNode = IN

p1 = Point.ByCoordinates(0, 0, 0);
p2 = Point.ByCoordinates(-10, -10, -10);

l = Line.ByStartPointEndPoint(p1, p2);

pts = [
	Point.ByCoordinates(0, 0, 0),
	Point.ByCoordinates(10, 10, 0),
	Point.ByCoordinates(20, 0, 0),
	Point.ByCoordinates(30, 10, 0),
	Point.ByCoordinates(40, 0, 0) ]
	
spline = NurbsCurve.ByPoints(pts)

surf = spline.Extrude(Vector.ByCoordinates(0, 0, 1), 10)

#Assign your output to the OUT variable
OUT = [l, spline, surf]
# ----------------------------------------

# group: Revisar saída resultante
# note: Dica: Use um Code Block para
# acessar determinados itens em uma lista.
code_block_4 = CodeBlock(output=python_script_2) { output[0]; output[1]; output[2]; }
watch_4 = Watch(code_block_4.out2)
watch_5 = Watch(code_block_4.out0)
watch_6 = Watch(code_block_4.out1)
