# Dynamo graph Core_RangeSyntax.dyn (Dynamo 3.0.0.6964)
# author: Dynamo Team
# Este gráfico fornece várias formas de gerar séries de números ou caracteres igualmente espaçados.

# group: Informações
# note: Sintaxe do intervalo
# Há diversas formas de criar listas como sequências de números ou caracteres.
# As sequências podem ser úteis ao criar matrizes de elementos, iterações e como preparação para várias funções e equações.

# group: Usar bloco de código
# note: start..end..step
# De 0 a 10 com um passo de 2
# Esse método é equivalente a usar o nó Range
code_block = CodeBlock { 0..10..2; }
watch = Watch(code_block)
# note: start..end
# Quando o valor do passo não é especificado, presume-se que seja 1.
# Esse método é idêntico ao uso do modo Range
# note: Usar a sintaxe do intervalo em um nó Code Block. Há vários e você precisa de vários métodos para gerar a série de números (ou caracteres):
#         start..end..step
#         start..end..#amount
#         start..#amount..interval
# start = número/caractere que inicia a série
# end = número/caractere que termina a série
# step = diferença entre dois números/caracteres consecutivos
# amount = quantos números/caracteres estão na série
code_block_2 = CodeBlock { 0..10; }
watch_2 = Watch(code_block_2)
# note: start..end..#amount
# De 0 a 10 em 3 etapas
code_block_3 = CodeBlock { 0..10..#3; }
watch_3 = Watch(code_block_3)
# note: start..#amount..interval
# 10 passos iniciando no 0, cada passo igual a 3
# Esse método é equivalente a usar o nó de sequência
code_block_4 = CodeBlock { 0..#10..3; }
watch_4 = Watch(code_block_4)

# group: Usar bloco de código com entrada dinâmica
integer_slider = IntegerSlider(7, range=0..10 step 1)
# note: Substituir um valor por uma variável e usar um controle deslizante para controlar de forma dinâmica o comprimento da lista.
code_block_5 = CodeBlock(howMany=integer_slider) { 0..#howMany..3; }
watch_5 = Watch(code_block_5)

# group: Usar sequência
number = DoubleInput(0)
number_slider = DoubleSlider(8, range=0..10 step 0.1)
number_2 = DoubleInput(2)
# note: Use um nó de sequência se o número de itens na lista e o comprimento de cada passo forem conhecidos. O último resultado na lista não é predefinido, mas calculado com base em outras entradas.
# Exemplo: projetar um estacionamento com espaços para 8 carros e uma largura conhecida de cada vaga de estacionamento. A largura total de todas as vagas de estacionamento depende das larguras individuais e do número de espaços.
sequence = Sequence(start=number, amount=number_slider, step=number_2, lacing=Longest)
watch_6 = Watch(sequence)

# group: Usar intervalo
number_3 = DoubleInput(0)
number_4 = DoubleInput(10)
number_slider_2 = DoubleSlider(1.75, range=0..10 step 0.1)
# note: Use um nó Range se o início e o fim da sequência forem conhecidos. O número de itens na lista resultante não é predefinido, mas calculado, com base em outras entradas.
# É importante notar que o último item na lista poderá não corresponder à entrada 'end' se o valor de“ step” se estender além de 'end' ao ultrapassá-lo por um passo adicional.
# Aumentar o valor de “step” entre 'start' e 'end' definidos pode resultar em menos itens, e vice-versa, reduzir o passo aumentará o tamanho da lista.
range = Range(start=number_3, end=number_4, step=number_slider_2, lacing=Longest)
watch_7 = Watch(range)

# group: Usar intervalo – com sequências de caracteres
string = StringInput("A")
string_2 = StringInput("P")
code_block_6 = CodeBlock { 1; }
# note: Também é possível usar o intervalo para gerar sequências de caracteres.
range_2 = Range(start=string, end=string_2, step=code_block_6, lacing=Longest)
watch_8 = Watch(range_2)

# group: Usar sequência – com sequências de caracteres
string_3 = StringInput("A")
code_block_7 = CodeBlock { 20; }
# note: Usar um nó de sequência para gerar uma série de letras em ordem alfabética
sequence_2 = Sequence(start=string_3, amount=code_block_7)
watch_9 = Watch(sequence_2)

# note: Usar a sequência de valores para criar uma série de pontos
byCoordinates = Point.ByCoordinates(x=code_block_5)
