# Dynamo graph Core_Strings.dyn (Dynamo 3.4.1.7055)
# author: Dynamo Team
# Este gráfico demonstra ações que podem ser executadas em sequências de caracteres.

# group: Informações
# note: SEQUÊNCIAS DE CARACTERES
# Este conjunto de exemplos demonstra algumas ações que podem ser executadas com sequências de caracteres. Mais nós para operações de sequência de caracteres podem ser encontrados na biblioteca de modelos na categoria 'String'

byCoordinates = Point.ByCoordinates()
code_block = CodeBlock { 5; }
# note: Criar um objeto – um círculo
byCenterPointRadius = Circle.ByCenterPointRadius(centerPoint=byCoordinates, radius=code_block)

# group: Converter objeto em sequência de caracteres
# note: Converta um objeto em uma descrição dele mesmo com sequência caracteres.
string_from_object = FromObject(obj=byCenterPointRadius)

watch = Watch(string_from_object)

# group: Dividir sequência de caracteres usando separadores
code_block_2 = CodeBlock { "("; ")"; " "; "="; ","; }
# note: Dividir uma sequência de caracteres em partes especificando um ou mais caracteres separadores. Cada separador pode ter um ou vários caracteres.
split = String.Split(string=watch, separator0=code_block_2.out0, separator1=code_block_2.out1, separator2=code_block_2.out2, separator3=code_block_2.out3, separator4=code_block_2.out4)

watch_2 = Watch(split)

# group: Verificar se a sequência de caracteres contém subsequência
code_block_3 = CodeBlock { "."; }
# note: Localize se uma sequência de caracteres contém outra sequência de caracteres.
contains = String.Contains(string=watch_2, searchFor=code_block_3)

watch_3 = Watch(contains)

# group: Criar sequência de caracteres
# note: Usar um Code Block para criar uma sequência de caracteres – as marcas “” delimitam o valor da sequência de caracteres.
code_block_4 = CodeBlock { "Few things are harder to put up with than a good example."; }

# group: Alterar para MAIÚSCULAS
string = StringInput(" - Mark Twain")
# note: Alterar o caso de uma sequência de caracteres
toUpper = String.ToUpper(string=string)
watch_4 = Watch(toUpper)

# group: Concatenar
# note: Anexe duas sequências de caracteres para criar uma denominada "concatenação" ou "concat" como abreviatura.
concat = String.Concat(string0=code_block_4, string1=watch_4)

watch_5 = Watch(concat)

# group: Substituir caracteres em uma sequência de caracteres
code_block_5 = CodeBlock { "put"; }
code_block_6 = CodeBlock { "come"; }
# note: Substituir todas as ocorrências de uma subsequência de caracteres por uma sequência de caracteres de substituição.
replace = String.Replace(string=watch_5, searchFor=code_block_5, replaceWith=code_block_6)

watch_6 = Watch(replace)

# group: Localizar uma subsequência de caracteres em uma sequência de caracteres
code_block_7 = CodeBlock { " to"; }
# note: Localizar onde uma determinada subsequência de caracteres ocorre em uma sequência de caracteres. O resultado é o índice no qual a subsequência de caracteres começa.
indexOf = String.IndexOf(string=watch_6, searchFor=code_block_7)
watch_7 = Watch(indexOf)

# group: Tamanho da sequência de caracteres
# note: Localize o número total de caracteres em uma sequência de caracteres.
length = String.Length(string=watch_6)
watch_8 = Watch(length)

# note: Subtrair a primeira parte da sequência de caracteres do tamanho total da sequência de caracteres
sub = watch_8 - watch_7

# group: Remover caracteres
# note: Remova um determinado número de caracteres de uma sequência de caracteres.
remove = String.Remove(string=watch_6, startIndex=watch_7, count=sub)

# group: Contar ocorrências
watch_9 = Watch(remove)
code_block_8 = CodeBlock { "ar"; }
# note: Contar as ocorrências de uma subsequência de caracteres dentro de uma sequência de caracteres.
countOccurrences = String.CountOccurrences(string=watch_9, searchFor=code_block_8)
watch_10 = Watch(countOccurrences)

# group: Criar sequência de caracteres
# note: Se a sequência de caracteres incluir um caractere ", use um caractere de escape \ antes de " para tratá-lo como parte da sequência de caracteres e não o fim da sequência de caracteres.
code_block_9 = CodeBlock { "There is no \"I\" in Team"; }
watch_11 = Watch(code_block_9)

intervalo_de_números = CodeBlock { 2..101; }

# group: Concatenar sequências de caracteres usando “Adicionar”
code_block_10 = CodeBlock { " Dalmatians"; }
# note: A operação “Adicionar” converte automaticamente os números em sequências de caracteres e executa a concatenação
add = intervalo_de_números + code_block_10
watch_12 = Watch(add)

# group: Converter objeto em sequência de caracteres
# note: Em algumas situações, é necessário primeiro converter um objeto em uma sequência de caracteres
string_from_object_2 = FromObject(object=intervalo_de_números)
watch_13 = Watch(string_from_object_2)
type = Object.Type(object=string_from_object_2)
watch_14 = Watch(type)

# group: Converter sequência de caracteres em número
code_block_11 = CodeBlock { "101 Dalmatians"; }
code_block_12 = CodeBlock { " "; }
# note: Dividir a sequência de caracteres em palavras usando o espaço como separador
split_2 = String.Split(string=code_block_11, separator0=code_block_12)
# note: Obter o primeiro item de uma lista
firstItem = List.FirstItem(list=split_2)
# note: Converter a sequência de caracteres em um número
toNumber = String.ToNumber(string=firstItem)
watch_15 = Watch(toNumber)
type_2 = Object.Type(object=toNumber)
watch_16 = Watch(type_2)

# group: Converter as sequências de caracteres em números
# note: Usar a lista booleana como uma máscara para um filtro a fim de obter todos os números em uma lista
filterByBoolMask = List.FilterByBoolMask(list=watch_2, mask=contains)
# note: Converter as sequências de caracteres em números
toNumber_2 = String.ToNumber(string=filterByBoolMask.in)

watch_17 = Watch(filterByBoolMask.in)
