# Dynamo graph Geometry_Curves.dyn (Dynamo 3.1.0.3411)
# author: Dynamo Team
# Um gráfico de amostra demonstrando como criar os primitivos de curva básicos – Linha, PolyCurve, curva Nurbs aberta e fechada

# group: Informações
# note: Este gráfico demonstra como criar os primitivos básicos de curva – Linha, PolyCurve, curva Nurbs aberta e fechada

# group: Entradas iniciais
number = DoubleInput(5)
number_2 = DoubleInput(10)
number_3 = DoubleInput(15)

# group: 4 pontos iniciais
byCoordinates = Point.ByCoordinates()
byCoordinates_2 = Point.ByCoordinates(y=number)
byCoordinates_3 = Point.ByCoordinates(x=number_2, y=number_2)
byCoordinates_4 = Point.ByCoordinates(x=number_3)

# group: Lista de 4 pontos
create = List.Create(item0=byCoordinates, item1=byCoordinates_2, item2=byCoordinates_3, item3=byCoordinates_4)

# group: Curva Nurbs
# note: Cria uma curva Nurbs por 4 pontos
byPoints = NurbsCurve.ByPoints(points=create)

# group: Linha
# note: Linha reta única por 2 pontos
byStartPointEndPoint = Line.ByStartPointEndPoint(startPoint=byCoordinates, endPoint=byCoordinates_2)

length = Curve.Length(curve=byStartPointEndPoint)

# group: Curva Nurbs – fechada
boolean = BoolSelector(true)
# note: Criar uma curva Nurbs fechada dentro dos pontos de delimitação
byControlPoints = NurbsCurve.ByControlPoints(points=create, closeCurve=boolean)

# group: PolyCurve
# Descrição <Clique duas vezes aqui para editar a descrição do grupo>
# note: Criar uma PolyCurve reta através de um conjunto de pontos
# note: Nova nota
byPoints_2 = PolyCurve.ByPoints(points=create)

# group: Ações e consultas
code_block = CodeBlock { 0..1..#20; }
# note: Curvas, Policurvas (coleções de curvas), NURBS e linhas, todas derivam de "Curvas" e, portanto, todas as "Ações" e "Consultas" de curva podem ser feitas para todos elas
pointAtParameter = Curve.PointAtParameter(curve=byPoints_2, param=code_block)
