# Dynamo graph Geometry_Points.dyn (Dynamo 3.1.0.3411)
# author: Dynamo Team
# Criar matriz de pontos

# group: Entradas iniciais
number_slider = DoubleSlider(6.4, range=0..10 step 0.1)

# group: Ponto único
# note: Os elementos geométricos básicos têm valores padrão para entradas numéricas. Verifique os valores padrão passando o cursor sobre a porta de entrada do nó
byCoordinates = Point.ByCoordinates(z=number_slider)

# group: Visualizar resultados
# note: Após pressionar “Executar” ou com Executar automaticamente ativado, consulte a entidade geométrica na Visualização do plano de fundo, no nó Watch 3D, ou como dados em um nó de inspeção. Os elementos serão realçados no plano de fundo quando o nó for selecionado
watch_3d = Watch3D(byCoordinates)

# group: Entradas iniciais
number = DoubleInput(0)
number_2 = DoubleInput(10)
number_3 = DoubleInput(1)

# group: Intervalo de números
# note: As matrizes de geometria podem ser criadas utilizando sequências, faixas e listas
range = Range(start=number, end=number_2, step=number_3, lacing=Longest)

# group: Matriz de pontos
# note: Criar matrizes dimensionais 1, 2 e 3 passando intervalos nas portas x, y e z dos pontos e, em seguida, alterando as propriedades de treliça no menu de contexto do nó. Observe o resultado ao escolher a opção Treliça do produto cartesiano.
byCoordinates_2 = Point.ByCoordinates(x=range, y=range, lacing=CrossProduct)

watch = Watch(byCoordinates)

# group: Transformar ponto em vetor
# Descrição <Clique duas vezes aqui para editar a descrição do grupo>
# note: Alguns elementos podem ser facilmente convertidos em outros
asVector = Point.AsVector(point=watch)

# group: Mover matriz pelo ponto como um vetor
# note: Os elementos derivativos podem ser criados usando as ferramentas na subcategoria Ações da entidade
add = Point.Add(point=byCoordinates_2, vectorToAdd=asVector)

# group: Visualizar coordenada “Z” do ponto
# note: É possível extrair informações da geometria usando nós na subcategoria de consulta de cada agrupamento de nós (ao lado do símbolo de ponto de interrogação)
Z = Point.Z(point=byCoordinates)
