# Dynamo graph Geometry_Solids.dyn (Dynamo 3.1.0.3411)
# author: Dynamo Team
# Um gráfico de amostra do Dynamo demostrando a criação de sólidos usando Elevação e manipulação de sólidos (adição e subtração)

# group: Ponto inicial para o primeiro grupo de curvas
byCoordinates = Point.ByCoordinates()
number = DoubleInput(10)
byCoordinates_2 = Point.ByCoordinates(x=number)
byCoordinates_3 = Point.ByCoordinates(y=number)

# group: Ponto adicional para o segundo grupo de curvas
number_2 = DoubleInput(5)
byCoordinates_4 = Point.ByCoordinates(z=number_2)

# group: Criar as curvas iniciais para a base inferior
byStartPointEndPoint = Line.ByStartPointEndPoint(startPoint=byCoordinates, endPoint=byCoordinates_2)
byThreePoints = Arc.ByThreePoints(firstPoint=byCoordinates, secondPoint=byCoordinates_4, thirdPoint=byCoordinates_2)

# group: Criar base inferior
create = List.Create(item0=byStartPointEndPoint, item1=byThreePoints)
byJoinedCurves = PolyCurve.ByJoinedCurves(curves=create)

# group: Ponto adicional para o terceiro grupo de curvas
number_3 = DoubleInput(15)
byCoordinates_5 = Point.ByCoordinates(x=number_3, y=number_3)

# group: Ponto adicional para o quarto grupo de curvas
number_4 = DoubleInput(5)
number_5 = DoubleInput(10)
byCoordinates_6 = Point.ByCoordinates(x=number_4, y=number_5, z=number_5)

# group: Criar as curvas iniciais para a base superior
byStartPointEndPoint_2 = Line.ByStartPointEndPoint(startPoint=byCoordinates_3, endPoint=byCoordinates_5)
byThreePoints_2 = Arc.ByThreePoints(firstPoint=byCoordinates_3, secondPoint=byCoordinates_6, thirdPoint=byCoordinates_5)

# group: Criar base superior
create_2 = List.Create(item0=byStartPointEndPoint_2, item1=byThreePoints_2)
byJoinedCurves_2 = PolyCurve.ByJoinedCurves(curves=create_2)

# group: Combinar curvas base numa lista
create_3 = List.Create(item0=byJoinedCurves, item1=byJoinedCurves_2)

# group: Elevação
# note: Existem múltiplos métodos de criação para a maioria dos sólidos.  Estes exemplos mostram os perfis fechados como a base, mas as polissuperfícies podem ser unidas, muitos primitivos estão disponíveis (Superfícies, Cubóide, Cone etc.)
byLoft = Solid.ByLoft(crossSections=create_3)

# group: Volume
# note: É possível verificar o volume da elevação demonstrando que é uma geometria sólida fechada
volume = Solid.Volume(solid=byLoft)

# group: Ponto adicional para a geometria de elevação adicional
number_6 = DoubleInput(-2)
number_7 = DoubleInput(5)
byCoordinates_7 = Point.ByCoordinates(x=number_6, y=number_7)

# group: Combinar pontos numa lista
create_4 = List.Create(item0=byCoordinates, item1=byCoordinates_7, item2=byCoordinates_3)

# group: Criar curva base adicional
# Descrição <Clique duas vezes aqui para editar a descrição do grupo>
# note: Desta vez cria uma curva Nurbs com base no grupo de pontos
byPoints = NurbsCurve.ByPoints(points=create_4)

# group: Elevação +
# note: Dica: desative "Visualizar" nos menus de contexto do nó para excluir elementos da exibição
byLoft_2 = Solid.ByLoft(crossSections=create_3, guideCurves=byPoints)

# group: Geometria +
code_block = CodeBlock { Vector.ByCoordinates(-20,0,0); }
# note: Mover geometria para visualizar saída
translate = Geometry.Translate(geometry=byLoft_2, direction=code_block)

# group: Preparar os “ingredientes” para aparar a geometria sólida
# note: Espessura
code_block_2 = CodeBlock { 0; }
# note: Dica: desative "Visualizar" nos menus de contexto do nó para excluir elementos da exibição
thinShell = Solid.ThinShell(solid=byLoft, internalFaceThickness=code_block_2)
code_block_3 = CodeBlock { Vector.ByCoordinates(20,0,0); }
# note: Mover a geometria na direção X por 20 unidades
translate_2 = Geometry.Translate(geometry=thinShell, direction=code_block_3)
code_block_4 = CodeBlock { Point.ByCoordinates(0,0,5); }
ZAxis = Vector.ZAxis()
# note: Criar um plano que atravessa o sólido com o qual cortar
byOriginNormal = Plane.ByOriginNormal(origin=code_block_4, normal=ZAxis)
# note: Esse ponto determina qual parte do sólido deve ser aparada
code_block_5 = CodeBlock { Point.ByCoordinates(10,10,10); }

# group: Elevação -
# note: As operações booleanas geométricas (Intersecção, Diferença, União etc.) estão disponíveis na categoria da geometria.
trim = Geometry.Trim(geometry=translate_2, other=byOriginNormal, pick=code_block_5)
