# Dynamo graph Geometry_Surfaces.dyn (Dynamo 3.1.0.3411)
# Um gráfico do Dynamo demostrando as principais formas de criar superfícies – Extrusão, Elevação e Varredura.

# group: Informações
# note: Um gráfico do Dynamo demostrando as principais formas de criação de superfícies – Extrusão, Elevação e Varredura

# group: Entrada
number = DoubleInput(10)
number_2 = DoubleInput(-10)
byCoordinates = Point.ByCoordinates(x=number, y=number_2)
byCoordinates_2 = Point.ByCoordinates(y=number_2)

# group: Linha
byStartPointEndPoint = Line.ByStartPointEndPoint(startPoint=byCoordinates, endPoint=byCoordinates_2)

# group: Entrada
byCoordinates_3 = Point.ByCoordinates()

# group: Entrada
number_3 = DoubleInput(5)
byCoordinates_4 = Point.ByCoordinates(z=number_3)

# group: Entrada
number_4 = DoubleInput(10)
byCoordinates_5 = Point.ByCoordinates(x=number_4)
byCoordinates_6 = Point.ByCoordinates(y=number_4)

# group: Arco
byThreePoints = Arc.ByThreePoints(firstPoint=byCoordinates_3, secondPoint=byCoordinates_4, thirdPoint=byCoordinates_5)

# group: Elevação
create = List.Create(item0=byStartPointEndPoint, item1=byThreePoints)
# note: Usando os dois conjuntos de curvas, podemos criar uma geometria de “Elevação” entre eles
byLoft = Surface.ByLoft(crossSections=create)

# group: Avaliar área de elevação
area = Surface.Area(surface=byLoft)
watch = Watch(area)

# group: Entrada
number_5 = DoubleInput(5)
number_6 = DoubleInput(10)
byCoordinates_7 = Point.ByCoordinates(x=number_5, y=number_6, z=number_6)

# group: Entrada
number_7 = DoubleInput(15)
byCoordinates_8 = Point.ByCoordinates(x=number_7, y=number_7)

# group: Arco
byThreePoints_2 = Arc.ByThreePoints(firstPoint=byCoordinates_6, secondPoint=byCoordinates_7, thirdPoint=byCoordinates_8)

# group: Entrada
number_8 = DoubleInput(-5)
number_9 = DoubleInput(5)
byCoordinates_9 = Point.ByCoordinates(x=number_8, y=number_9)

# group: Arco
byThreePoints_3 = Arc.ByThreePoints(firstPoint=byCoordinates_3, secondPoint=byCoordinates_9, thirdPoint=byCoordinates_6)

# group: Varredura
# note: Existem múltiplos métodos de criação para a maioria das superfícies.  As Superfícies, Polissuperfícies (coleções de superfícies) e as Superfícies NURBS podem ser criadas por pontos, curvas e derivadas de outras superfícies e sólidos
bySweep2Rails = Surface.BySweep2Rails(path=byThreePoints_2, guideRail=byThreePoints, profile=byThreePoints_3)

# group: Combinar a elevação e a varredura
create_2 = List.Create(item0=byLoft, item1=bySweep2Rails)
# note: As superfícies unidas como Polissuperfícies podem ser consideradas como uma entidade única
byJoinedSurfaces = PolySurface.ByJoinedSurfaces(surfaces=create_2)

# group: Avaliar a combinação da área de elevação + área de varredura
area_2 = Surface.Area(surface=byJoinedSurfaces)
watch_2 = Watch(area_2)

# group: Avaliar área de varredura
area_3 = Surface.Area(surface=bySweep2Rails)
watch_3 = Watch(area_3)

# group: Extrair e usar pontos da superfície
code_block = CodeBlock { 0..1..0.1; }
# note: As arestas, os pontos e outros recursos podem ser derivados de superfícies usando “Ações” apropriadas para essas geometrias
pointAtParameter = Surface.PointAtParameter(surface=bySweep2Rails, u=code_block, v=code_block, lacing=CrossProduct)
# note: Criar uma nova superfície Nurbs usando os parâmetros extraídos (pontos).
# Ocultar o restante das geometrias para observar o resultado da geometria abaixo.
byControlPoints = NurbsSurface.ByControlPoints(controlVertices=pointAtParameter)
watch_3d = Watch3D(byControlPoints)

# group: Extrusão
code_block_2 = CodeBlock { 10; }
# note: Uma extrusão básica da curva fornecida
extrude = Curve.Extrude(curve=byThreePoints_2, distance=code_block_2)
