# Dynamo graph ImportExport_CSV to Stuff.dyn (Dynamo 3.1.0.3411)
# author: Dynamo Team
# Criar geometria com base em dados csv analisados

# group: Entrada helix.csv inicial
# note: Procurar um arquivo CSV que tem números
# no espaço de coordenadas x, y e z
file_path = Filename("..\..\Data\helix.csv")

# group: Leia o arquivo
fromPath = FileObject(path=file_path)  # "File.FromPath"
readText = FileSystem.ReadText(file=fromPath)

# group: Analisar os dados csv
string = StringInput("\n")
# note: Dividir a sequência de caracteres em
# um retorno de carro <enter>
split = String.Split(string=readText, separator0=string)
string_2 = StringInput(",")
# note: Dividir a sequência de caracteres na vírgula
split_2 = String.Split(string=split, separator0=string_2)
# note: Os arquivos CSV fornecem sequências de caracteres, não números
toNumber = String.ToNumber(string=split_2)
# note: Grupo de componentes X, Y e Z
transpose = List.Transpose(lists=toNumber)

# group: Criar a geometria de “espiral” com base nos pontos recuperados do arquivo csv
# note: Coordenada “X”
firstItem = List.FirstItem(list=transpose)
code_block = CodeBlock { 1; }
# note: Coordenada “Y”
getItemAtIndex = List.GetItemAtIndex(list=transpose, index=code_block)
# note: Coordenada “Z”
lastItem = List.LastItem(list=transpose)
byCoordinates = Point.ByCoordinates(x=firstItem, y=getItemAtIndex, z=lastItem)

# group: Dimensionar verticalmente
number_slider = DoubleSlider(2.337, range=0..20 step 0.1)
# note: Ajustar a distribuição global
# dos pontos de coordenadas
scale = Geometry.Scale(geometry=byCoordinates, amount=number_slider, lacing=Longest)
