# Dynamo graph ImportExport_Excel to Dynamo.dyn (Dynamo 3.1.0.3411)
# author: Dynamo Team
# Um gráfico de amostra mostrando como importar dados do Excel para o Dynamo.

# group: Entradas iniciais
# note: Navegar para o caminho do arquivo do Excel .xlsx do qual carregar dados.
file_path = Filename("..\..\Data\helix.xlsx")
# note: Obter o arquivo do caminho do arquivo.
fromPath = FileObject(path=file_path)  # "File.FromPath"
# note: O nome da planilha no Excel que contém os dados que desejamos importar.
string = StringInput("helix")

# group: Importar dados do Excel
# note: Esse nó pode ler dados provenientes da planilha do Excel. Ele lerá todas as colunas e linhas, e os dados resultantes estarão contidos em uma matriz dupla [][] (matriz).
importExcel = Data.ImportExcel(file=fromPath, sheetName=string)

# group: Transpor
# note: Inverter (transpor) a lista (a matriz). As colunas se tornam linhas e as linhas se tornam colunas.
transpose = List.Transpose(lists=importExcel)

# group: Extrair as coordenadas dos pontos
number = DoubleInput(0)
# note: Coordenada X
getItemAtIndex = List.GetItemAtIndex(list=transpose, index=number)
number_2 = DoubleInput(1)
# note: Coordenada Y
getItemAtIndex_2 = List.GetItemAtIndex(list=transpose, index=number_2)
number_3 = DoubleInput(2)
# note: Coordenada Z
getItemAtIndex_3 = List.GetItemAtIndex(list=transpose, index=number_3)

# group: Construir a hélice com base nos dados extraídos do Excel
byCoordinates = Point.ByCoordinates(x=getItemAtIndex, y=getItemAtIndex_2, z=getItemAtIndex_3, lacing=Longest)
