# Dynamo graph OpenXMLExport_Data To Excel.dyn "OpenXMLExport_Data para Excel" (Dynamo 3.0.3.7594)
# author: Dynamo Team
# Um gráfico de amostra do Dynamo mostrando como exportar dados para o Excel.

# group: Entradas iniciais
# note: Gera o número de pontos. Pense nele como a “altura” da hélice.
number_slider = DoubleSlider(1.7, range=0..5 step 0.1)

# group: Criar a hélice
# note: Criar uma série de números, começando em 0. O incremento é 10. O número de pontos é multiplicado por 360; portanto, se a entrada 'numCircles' for 1 - o resultado é 37 números (0 a 360) e obteremos uma revolução completa da hélice.
code_block = CodeBlock(numCircles=number_slider) { 0..(360*numCircles)..10; }
# note: função cosseno
cos = Math.Cos(angle=code_block, lacing=Longest)
# note: função seno
sin = Math.Sin(angle=code_block, lacing=Longest)
# note: dividir por 100
code_block_2 = CodeBlock(x=code_block) { x/100; }
# note: Criar uma lista de pontos, o componente X é o cosseno, o Y - o seno e o Z é o valor inicial dividido por 100.
byCoordinates = Point.ByCoordinates(x=cos, y=sin, z=code_block_2, lacing=Longest)
# note: Criar uma estrutura de lista com base na lista de pontos – o resultado é uma lista que contém 3 listas ([][] – matriz dupla), cada uma contendo as coordenadas de ponto X, Y e Z, respectivamente.
code_block_3 = CodeBlock(pt=byCoordinates) { [pt.X,pt.Y,pt.Z]; }

# group: Criar as entradas para a exportação
# 1. O caminho para o arquivo csv.
# 2. O nome da planilha.
# 3. A lista de pontos transposta.
# 4. O índice inicial para a linha e a coluna no Excel.
# note: O caminho para o arquivo xlsx.
file_path = Filename("..\..\Data\icosohedron_points.xlsx")
# note: O nome da planilha no Excel.
string = StringInput("helix")
# note: Inverter a matriz (transpor a lista). As colunas se tornam linhas e as linhas se tornam colunas.
transpose = List.Transpose(lists=code_block_3)
# note: O número de colunas/linhas para iniciar o registro dos dados no Excel
number = DoubleInput(0)

# group: Exportar dados para um arquivo do Excel
# note: Exporta dados para o Excel
openXMLExportExcel = Data.OpenXMLExportExcel(filePath=file_path, sheetName=string, data=transpose, startRow=number, startColumn=number)
