# Dynamo graph OpenXMLImport_Data From Excel.dyn "OpenXMLImport_Data do Excel" (Dynamo 3.1.0.3411)
# author: Dynamo Team
# Um gráfico de amostra mostrando como importar dados de um arquivo do Excel.

# group: Entradas iniciais
# 1. O caminho para o arquivo do Excel.
# 2. O nome da planilha
file_path = Filename("..\..\Data\helix.xlsx")
string = StringInput("helix")

# group: Extrai dados do Excel
# note: Ler dados do Excel
openXMLImportExcel = Data.OpenXMLImportExcel(filePath=file_path, sheetName=string)

# group: Analisar os dados do Excel
# Os dados de “análise” são o processo de manipular uma origem de dados de forma a torná-la nativa do ambiente antes de usá-la.
# note: Transpor a lista (inverter a matriz). As colunas se tornam linhas e as linhas se tornam colunas.
transpose = List.Transpose(lists=openXMLImportExcel)
# note: primeira lista
number = DoubleInput(0)
# note: segunda lista
number_2 = DoubleInput(1)
# note: terceira lista
number_3 = DoubleInput(2)

# group: Criar a hélice
# note: Coordenada X
getItemAtIndex = List.GetItemAtIndex(list=transpose, index=number)
# note: Coordenada Y
getItemAtIndex_2 = List.GetItemAtIndex(list=transpose, index=number_2)
# note: Coordenada Z
getItemAtIndex_3 = List.GetItemAtIndex(list=transpose, index=number_3)
byCoordinates = Point.ByCoordinates(x=getItemAtIndex, y=getItemAtIndex_2, z=getItemAtIndex_3, lacing=Longest)
