# Dynamo graph Basics_Basic01.dyn (Dynamo 2.19.3.6543)
# author: Dynamo Team
# Добавление двух чисел путем соединения узлов

# note: Основные функциональные входные данные, такие как числа и строки могут быть выбраны путем просмотра или поиска в библиотеке в левой части активного окна.
# Такие операции с данными, как математические вычисления и геометрические преобразования, также доступны в библиотеке
# note: Dynamo представляет собой язык визуального программирования. Как и в случае других языков, его работа основана на связывании простых элементов для формирования более сложных идей
# note: Перетащите соединитель из порта «>» на узел Number и соедините его с портом «y» на узле «+», а затем нажмите кнопку «Выполнить» в левом нижнем углу приложения.
number = DoubleInput(2)  # graph input
add = number + _  # unwired: y
# note: Данные можно визуализировать нажатием кнопки «Запуск» в правом нижнем углу окна приложения. Если выбран режим «Автоматически», приложение будет постоянно обновляться.
# Данные можно просматривать с помощью узла Watch либо щелчком на небольшом квадрате в нижней части большинства узлов.
watch = Watch(add)
# note: Другие файлы образцов можно найти в меню «Справка». Чтобы вернуться к странице приветствия, закройте этот файл, нажав на вкладке значок «X».
number_2 = DoubleInput(6)  # graph input
