# Dynamo graph Basics_Basic02.dyn (Dynamo 2.19.3.6543)
# author: Dynamo Team
# Создание линии путем соединения двух точек

# note: Изменение положения точки в среде Dynamo: выберите узел Point.ByCoordinates и перейдите к фоновому просмотру, чтобы перетащить точку вдоль трех ее осей.
byCoordinates = Point.ByCoordinates()
# note: Геометрические данные можно просматривать в виде текстовой информации или в 3D-пространстве
watch = Watch(byCoordinates)
number = DoubleInput(2)  # graph input
# note: Используйте узлы Number Slider или Integer Slider для динамического ввода значения в пределах заданного диапазона. Щелкните синюю стрелку раскрывающегося списка, чтобы открыть параметры числового диапазона
number_slider = DoubleSlider(4.43, range=0..10 step 0.1)  # graph input
# note: Можно переключаться между навигацией в фоновом 3D-просмотре и по виду графика с помощью кнопок в правом верхнем углу экрана (CTRL + B). Режим «Фоновый просмотр» также можно включить и отключить в меню вида для Dynamo и Revit.
byCoordinates_2 = Point.ByCoordinates(x=number, z=number_slider)
byStartPointEndPoint = Line.ByStartPointEndPoint(startPoint=byCoordinates_2, endPoint=byCoordinates)
# note: Используйте узел Watch 3D для визуализации 3D-элемента изолированно
watch_3d = Watch3D(byStartPointEndPoint)
