# Dynamo graph Basics_Basic03.dyn (Dynamo 2.19.3.6543)
# author: Dynamo Team
# Создание простого списка

# group: Входные данные
# note: Списки данных можно создавать с помощью последовательностей и диапазонов. Эти списки можно перегруппировать с многими другими узлами для особых целей.
number = DoubleInput(0)  # graph input
number_2 = DoubleInput(9)  # graph input
number_3 = DoubleInput(1)  # graph input

# note: Создание последовательности чисел в диапазоне от Start до End с заданным значением шага Step
range = Range(start=number, end=number_2, step=number_3, lacing=Longest)
watch = Watch(range)
number_4 = DoubleInput(3)  # graph input
# note: Разделение списка на части с длиной 3
chop = List.Chop(list=range, lengths=number_4)
# note: Просмотр результата и структуры списка с помощью узла Watch
watch_2 = Watch(chop)
# note: Получение последнего элемента в списке
lastItem = List.LastItem(list=range)
watch_3 = Watch(lastItem)
