# Dynamo graph Core_AttractorPoint.dyn (Dynamo 3.0.0.6964)
# author: Dynamo Team
# Этот график создает сетку из цилиндров, размеры в которой определяются положением точки притяжения.

# group: Сведения
# note: ТОЧКА ПРИТЯЖЕНИЯ
# Точка притяжения — это опорная точка (или элемент), влияющая на характеристики других элементов в системе. Точка притяжения часто работает как магнит: чем ближе элемент к точке притяжения, тем больше она на него влияет.
# В этом примере высота и диаметр цилиндров определяются расстоянием между каждым цилиндром и точкой притяжения, относительно которой он располагается. Цилиндры рядом с точкой притяжения меньше, чем те, что расположены дальше.
# Для визуализации этого поведения передвиньте два регулятора чисел на порте ввода точки притяжения.
# Точки притяжения позволяют добавить уровень отклика и динамическое поведение в процесс проектирования.

# group: Размер сетки из точек
# note: Используйте узел Code Block для создания последовательности чисел. В этом случае создается последовательность чисел от 1 до 50 с n-м числом шагов, где каждый шаг равен 5
numbers_range = CodeBlock { 1..50..5; }

# group: Создание сетки из точек
# note: Сетка из точек.
# Для ее создания требуется передать последовательность чисел в два порта для координат X и Y. Щелкните узел правой кнопкой мыши и измените режим переплетения на «Векторное произведение»
# note: Переплетение «Векторное произведение» объединяет каждый элемент из одного списка с каждым элементом из каждого другого списка, что приводит к созданию сетчатой структуры списков.
# При использовании с входными данными X и Y узла Point.ByCoordinates получается плоская сетка из точек. Если используется третья координата Z, сетка будет кубической.
byCoordinates = Point.ByCoordinates(x=numbers_range, y=numbers_range, lacing=CrossProduct)

# group: Упрощение структуры списков
# Сложная структура списков не требуется для дальнейших действий с точками. Используйте узел Flatten для создания одного списка.
# note: Преобразование списка в плоскую структуру по причине отсутствия необходимости в строках и столбцах. Сравните входные данные этого узла с выводными: структура из нескольких списков (N) сменилась одним списком.
flatten = List.Flatten(list=byCoordinates)

# group: Местоположение точки притяжения
number_slider = DoubleSlider(24.6, range=-10..60 step 0.1)  # graph input
number_slider_2 = DoubleSlider(11.50111001, range=-10..60 step 0.1)  # graph input
# note: Точка притяжения. Переместите регуляторы ввода для настройки местоположения этой точки.
byCoordinates_2 = Point.ByCoordinates(x=number_slider, y=number_slider_2)

# group: Расстояние до точки притяжения
# note: Поиск расстояния между точкой притяжения и каждой базовой точкой цилиндров
distanceTo = Geometry.DistanceTo(geometry=flatten, other=byCoordinates_2)

# group: Генерация значений радиуса и высоты
# note: Формула для формирования связи высоты цилиндров с местоположением точки притяжения. В этом примере высота каждого цилиндра равна половине расстояния до точки притяжения. Попробуйте использовать другую формулу.
cylinder_height = CodeBlock(x=distanceTo) { x/2; }
# note: Формула возвращает значение, используемое в качестве радиуса цилиндра. Чем больше расстояние, тем больше радиус каждого цилиндра. Попробуйте использовать другую формулу.
cylinder_radius = CodeBlock(x=distanceTo) { x/15; }

# group: Конечные точки
# Преобразование начальной (исходной) точки каждого цилиндра с использованием высоты, заданной формулой
# note: Вектор для перемещения базовой (исходной) точки вверх на заданное значение
byCoordinates_3 = Vector.ByCoordinates(z=cylinder_height)
# note: Добавьте новое значение Z (высота) к исходным точкам сетки, чтобы получить верхние точки цилиндров.
add = Point.Add(point=flatten, vectorToAdd=byCoordinates_3)

# group: Создание цилиндров
# note: Используйте метод, который создает цилиндр с указанными начальной и конечной точками и заданным радиусом
byPointsRadius = Cylinder.ByPointsRadius(startPoint=flatten, endPoint=add, radius=cylinder_radius)
