# Dynamo graph Core_CodeBlocks.dyn (Dynamo 3.4.1.7055)
# author: Dynamo Team
# Этот график анализирует различные модели применения блоков кода

# group: Сведения
# note: БЛОКИ КОДА
# Блоки кода можно создать двойным щелчком в активном окне. Блок кода также можно найти в библиотеке узлов в категории Script > Editor.
# Блоки кода могут содержать:
# • числовые значения (целые числа и числа с плавающей точкой);
# • строки (текст);
# • логические значения (True или False);
# • списки [0,1,2];
# • выражения (a+3);
# • переменные.
# Другие узлы можно преобразовать в выражение блока кода: выберите один или несколько узлов, щелкните правой кнопкой мыши в пространстве между узлами и выберите «Узел для кодировки». Обратного действия нет: блоки кода невозможно автоматически преобразовать в узлы.

# group: Узлы как блоки кода
# note: Узлы Code Block можно использовать для вызова любого другого узла из библиотеки. Узлы в библиотеке обычно бывают трех типов.
#     Создание:	создание чего-либо.
#     Действие:	выполнение действия
# 		в отношении чего-либо.
#     Запрос:		получение свойства того,
# 		что уже существует.
# Методы, или узлы, этих трех типов обрабатываются по-разному при вызове с помощью узла Code Block.

# group: Создание геометрии
# note: Эти два выражения вместе образуют алгоритм, который создает спиральную кривую в базовой точке.
code_block = CodeBlock()
# ---------- code_block.designscript (16 lines) ----------
// Basic inputs
base = Point.ByCoordinates(3,3);
coils = 3;
height = 5;
rad = 0.5;

// Make a series of points
numPts = 8*coils + 1;
seq = 0..(coils*360)..#numPts;
x = rad * Math.Cos(seq);
y = rad * Math.Sin(seq);
z = 0..height..#numPts;
pts = Point.ByCoordinates(x + base.X, y + base.Y, z + base.Z);

// Pass a curve through those points
NurbsCurve.ByPoints(pts);
# ----------------------------------------
# note: Спиральный алгоритм преобразуется в функцию путем присвоения ему имени, определения ввода и характера результатов.
code_block_2 = CodeBlock()
# ---------- code_block_2.designscript (13 lines) ----------
def MakeSpring(base,coils,height,rad)
{
// Make a series of points
numPts = 8*coils + 1;
seq = 0..(coils*360)..#numPts;
x = rad * Math.Cos(seq);
y = rad * Math.Sin(seq);
z = 0..height..#numPts;
pts = Point.ByCoordinates(x + base.X, y + base.Y, z + base.Z);

// Return the curve that passes through those points
return = NurbsCurve.ByPoints(pts);
};
# ----------------------------------------
code_block_3 = CodeBlock { 0..6..2; }
code_block_4 = CodeBlock { 10..20..2; }
# note: Спиральный алгоритм преобразуется, определяя функцию с произвольным именем «MakeSpring». Эта функция вызывается, чтобы сформировать сетку из нескольких пружин любой высоты.
# note: создание сетки
byCoordinates = Point.ByCoordinates(x=code_block_3, y=code_block_4, lacing=CrossProduct)
flatten = List.Flatten(list=byCoordinates)
code_block_5 = CodeBlock { 5; }
count = List.Count(list=flatten)
# note: создается последовательность случайных чисел (с масштабным коэффициентом 5) для значений высоты пружины
randomList = Math.RandomList(amount=count)
code_block_6 = CodeBlock(random=randomList) { random * 5; }
# note: Входные данные для вызова функций можно создать с помощью списков элементов единого значения. Данные можно передать через порт или ввести непосредственно, как в случае значения 0,5 для радиуса всех пружин.
code_block_7 = CodeBlock(basePoints=flatten, numCoils=code_block_5, height=code_block_6) { MakeSpring(basePoints,numCoils,height,0.5); }

# group: Функции
# note: Функции могут быть определены непосредственно в узле Code Block, вызываемом в другом месте для данного определения.
# Первая строка содержит последовательность из ключевого слова def, имени функции и входных значений в скобках.
# Фигурные скобки определяют тело функции. Каждая строка должна заканчиваться точкой с запятой.
# Возвращаемое значение выглядит следующим образом: return = .
code_block_8 = CodeBlock()
# ---------- code_block_8.designscript (11 lines) ----------
/* This is a multi-line comment,
     which continues for mulitple
     lines. */

def FunctionName(input1, input2)
{
// This is a comment
sum = input1 + input2;

return = sum;
};
# ----------------------------------------
code_block_9 = CodeBlock { 1; }
# note: В узлах Code Block, определяющих функцию, отсутствуют входные и выходные порты, так как они были вызваны из других узлов Code Block.
code_block_10 = CodeBlock { 2; }
# note: Вызовите функцию с помощью другого узла Code Block в том же файле, указав то же имя и число аргументов.
code_block_11 = CodeBlock(in1=code_block_9, in2=code_block_10) { FunctionName(in1,in2); }
watch = Watch(code_block_11)
code_block_12 = CodeBlock { "cat"; }
code_block_13 = CodeBlock { "dog"; }
# note: Тип входных аргументов не указан в определении функции, поэтому она будет работать со всеми типами.
code_block_14 = CodeBlock(in1=code_block_12, in2=code_block_13) { FunctionName(in1,in2); }
watch_2 = Watch(code_block_14)
origin = Point.Origin()
code_block_15 = CodeBlock { 16; }
# note: Вызов функции с входными данными, не имеющими смысла для данной функции, даст в результате нулевое значение.
code_block_16 = CodeBlock(in1=origin, in2=code_block_15) { FunctionName(in1,in2); }
watch_3 = Watch(code_block_16)

# group: Числовые значения
# Сравнение специализированных узлов с Code Block
# note: Специализированный
number = DoubleInput(3.14)
result = Watch(number)
# note: Блок кода
code_block_17 = CodeBlock { 3.140; }
watch_4 = Watch(code_block_17)

# group: Строковые значения
# Сравнение специализированных узлов с Code Block
# note: Специализированный
string = StringInput("Less is more.")
result_2 = Watch(string)
# note: Используйте кавычки "" для создания строки с узлом Code Block
code_block_18 = CodeBlock { "Less is more."; }
watch_5 = Watch(code_block_18)
# note: Используйте этот узел для просмотра типа выходного значения
type = Object.Type(object=code_block_18)
watch_6 = Watch(type)

# group: Выражения
# Выполнение операции умножения с помощью специализированного узла * и Code Block
number_2 = DoubleInput(3)
number_3 = DoubleInput(5)
# note: Умножение двух чисел с помощью узла *
mul = number_2 * number_3
result_3 = Watch(mul)
# note: Выполнение умножения с помощью Code Block
code_block_19 = CodeBlock { 3*5; }
watch_7 = Watch(code_block_19)
code_block_20 = CodeBlock { 3; }
code_block_21 = CodeBlock { 5; }
# note: Использование переменных в качестве входных данных для операции умножения.
code_block_22 = CodeBlock(a=code_block_20, b=code_block_21) { a*b; }
watch_8 = Watch(code_block_22)

# group: Запрос
# Методы, которые запрашивают и возвращают свойство объекта
# note: С помощью узлов Code Block вы можете определить, как указывать входные данные. В качестве примера ниже представлено несколько разных способов создания одной точки.
code_block_23 = CodeBlock { 10; }
code_block_24 = CodeBlock { -10; }
# note: Стандартный метод с использованием узла Point.ByCoordinates
byCoordinates_2 = Point.ByCoordinates(x=code_block_23, y=code_block_24)
watch_9 = Watch(byCoordinates_2)
# note: В Code Block используется метод Point.ByCoordinates с тремя переменными для X, Y и Z, где Z определяется в том же узле Code Block и отделяется точкой с запятой (;)
code_block_25 = CodeBlock(x=code_block_23, y=code_block_24) { z = 0; Point.ByCoordinates(x,y,z); }
watch_10 = Watch(code_block_25.out1)
code_block_26 = CodeBlock { Point.ByCoordinates(10,0,0); }
# note: Эквивалент узла Code Block того же метода. Методы запроса не требуют скобок
code_block_27 = CodeBlock(pt=code_block_26) { pt.X; }
watch_11 = Watch(code_block_27)
# note: Стандартный метод запроса, который возвращает координату X точки
X = Point.X(point=code_block_26)
watch_12 = Watch(X)
# note: Формула использования отрицательного значения того же числового значения интегрирована в запись для входных переменных
code_block_28 = CodeBlock(num=code_block_23) { Point.ByCoordinates(num,-num,0); }
watch_13 = Watch(code_block_28)
# note: В Code Block используется метод Point.ByCoordinates, все три переменные предоставляются в качестве входных данных
code_block_29 = CodeBlock { Point.ByCoordinates(10,-10,0); }
watch_14 = Watch(code_block_29)

# group: Создать
# Методы создания геометрии, списков, элементов Revit или других объектов
# note: Стандартный метод создания точки в начале координат
origin_2 = Point.Origin()
watch_15 = Watch(origin_2)
# note: Хотя этот метод не требует ввода данных, скобки являются обязательными
code_block_30 = CodeBlock { Point.Origin(); }
watch_16 = Watch(code_block_30)
code_block_31 = CodeBlock { 0; -10; }
# note: Стандартный метод создания точки путем указания координат X и Y
byCoordinates_3 = Point.ByCoordinates(x=code_block_31.out0, y=code_block_31.out1)
watch_17 = Watch(byCoordinates_3)
# note: Используйте узел Code Block для реплицирования поведения узла Point.ByCoordinates. Чтобы найти имя метода, наведите указатель на исходный стандартный узел: метод указан в нижней части окна подсказки.
# Входные данные необходимо вводить в порядке, указанном в стандартном узле.
code_block_32 = CodeBlock { Point.ByCoordinates(0,-10); }
watch_18 = Watch(code_block_32)

# group: Действие
# Методы, выполняющие действие в отношении объекта
origin_3 = Point.Origin()
ZAxis = Vector.ZAxis()
# note: Стандартный метод добавления вектора к точке
add = Point.Add(point=origin_3, vectorToAdd=ZAxis)
watch_19 = Watch(add)
origin_4 = Point.Origin()
ZAxis_2 = Vector.ZAxis()
# note: Методы действий выполняются в отношении объекта. Используйте запись через точку после самого объекта и укажите метод и все входные данные, найденные в стандартном узле, кроме первого (поскольку первый порт ввода является самим объектом, который у вас уже есть).
code_block_33 = CodeBlock(pt=origin_4, vector=ZAxis_2) { pt.Add(vector); }
watch_20 = Watch(code_block_33)

# group: Создание списков
# note: Создание списков с помощью квадратных скобок для определения списка и запятых для разделения элементов
code_block_34 = CodeBlock { ["San Francisco","New York","Chicago"]; }
watch_21 = Watch(code_block_34)
# note: Получение элементов из списка с помощью следующей записи: list [ i ], где i — индекс элемента. Этот метод идентичен использованию узла GetItemAtIndex
code_block_35 = CodeBlock(cities=watch_21) { cities[2]; }
watch_22 = Watch(code_block_35)
# note: Multiple variables are defined in this code block, and at the end, a list is created containing all of them.
code_block_36 = CodeBlock()
# ---------- code_block_36.designscript (7 lines) ----------
str0 = "alpha";
str1 = "beta";
str2 = "charlie";
str3 = "delta";
str4 = "echo";
//
[str0,str1,str2,str3,str4];
# ----------------------------------------
watch_23 = Watch(code_block_36.out5)
code_block_37 = CodeBlock(phonetic=watch_23) { phonetic[2..3]; }
watch_24 = Watch(code_block_37)
code_block_38 = CodeBlock { 2; }
getItemAtIndex = List.GetItemAtIndex(list=watch_21, index=code_block_38)
watch_25 = Watch(getItemAtIndex)

# group: Объединение списков и доступ к элементам списка
# Описание <Дважды нажмите здесь, чтобы изменить описание группы>
# note: Создание вложенных списков и получение из них элементов.
code_block_39 = CodeBlock()
# ---------- code_block_39.designscript (6 lines) ----------
kitchen = ["table","stove","sink","refrigerator"];
livingRoom = ["sofa","books"];
bedroom = ["bed","dirty clothes"];
bathroom = ["tooth brush"];
//
allMyStuff = [kitchen, livingRoom, bedroom, bathroom];
# ----------------------------------------
watch_26 = Watch(code_block_39.allMyStuff)
# note: Доступ ко второму элементу в третьем списке (другими словами, доступ к элементу с индексом 1 внутри списка с индексом 2)
code_block_40 = CodeBlock(list=watch_26) { list[2][1]; }
watch_27 = Watch(code_block_40)

# group: Репликация
# note: Руководство по репликации можно использовать для указания того, что эти списки следует переплести с использованием режима «Векторное произведение».
code_block_41 = CodeBlock { x_vals = 0..10; y_vals = -30..-40; }
code_block_42 = CodeBlock(x_vals=code_block_41.x_vals, y_vals=code_block_41.y_vals) { Point.ByCoordinates(x_vals, y_vals); }
code_block_43 = CodeBlock { x_vals = 0..10; y_vals = -15..-25; }
code_block_44 = CodeBlock(x_vals=code_block_43.x_vals, y_vals=code_block_43.y_vals) { Point.ByCoordinates(x_vals<1>, y_vals<2>); }
byCoordinates_4 = Point.ByCoordinates(x=code_block_41.x_vals, y=code_block_41.y_vals)
byCoordinates_5 = Point.ByCoordinates(x=code_block_43.x_vals, y=code_block_43.y_vals, lacing=CrossProduct)
# note: В руководствах по репликации, в которых используются угловые скобки, берутся две или три линейных коллекции, при этом элементы объединяются для создания одно-, дву- или трехмерной коллекции.
# note: В этом примере представлены 2 значения X и 5 значений Y. В руководствах по репликации можно указать, что результирующая комбинация состоит из двух списков из пяти точек или пяти списков из двух точек.
code_block_45 = CodeBlock()
# ---------- code_block_45.designscript (5 lines) ----------
x_vals = 0..1;
y_vals = -3..-7;
//
Point.ByCoordinates(x_vals<1>, y_vals<2>);
Point.ByCoordinates(x_vals<2>, y_vals<1>);
# ----------------------------------------
watch_28 = Watch(code_block_45.out2)
watch_29 = Watch(code_block_45.out3)

# group: Логический
# Сравнение специализированных узлов с Code Block
# note: Узел переключения логических значений
boolean = BoolSelector(true)
watch_30 = Watch(boolean)
# note: Используйте значение true или false в Code Block для достижения того же результата
code_block_46 = CodeBlock { true; }
watch_31 = Watch(code_block_46)
