# Dynamo graph Core_ListAtLevel.dyn (Dynamo 3.1.0.3411)
# author: Dynamo Team
# Мы изучаем функцию List@Level и то, как ее можно использовать, чтобы получить такие же результаты, как и при работе с узлом List.Map. Мы создаем ряд панелей, демонстрирующих фактическую работу функции List@Level.

# group: Сведения
# note: Чтобы определить уровень списка для работы, изучите нижнюю часть окна предварительного просмотра или обратите внимание на узел и следуйте вверх по линиям обозначений List@Level.

# group: Сведения
# Общие сведения об использовании List@Level
# note: LIST@LEVEL
# List@Level заменяет функциональные возможности List.Map, позволяя напрямую выбрать уровень списка для работы.
# note: Чтобы изменить уровень списка, с которым вы работаете, щелкните стрелку рядом с портом ввода списка и включите параметр «Использовать уровни».
# Когда функция List@Level впервые включается в порте ввода, для работы выбирается список на втором внутреннем уровне.

# group: Сведения
# Принцип работы графика
# note: Необходимо создать панели на внутренней части сетки. Чтобы это сделать, понадобится получить точки в индексах 1 и 2 каждого списка самого глубокого уровня. Это легко можно выполнить, воспользовавшись функцией List@Level. Группировка списков поддерживается путем включения параметра «Сохранить структуру списков». Однако в первую очередь рассмотрим подробнее список, созданный с помощью Point.ByCoordinates, чтобы определить, какой уровень списка следует использовать.

# group: Входные данные
# Описание <Дважды нажмите здесь, чтобы изменить описание группы>
code_block = CodeBlock { 0..30..#8; 12..0..#4; }
# note: В данном примере будет создан 3D-список, содержащий серию точек. На третьем уровне есть восемь списков, каждый из которых содержит еще четыре списка второго уровня. Каждый из этих четырех списков содержит четыре точки первого уровня, что в результате составляет 128 точек.
byCoordinates = Point.ByCoordinates(x=code_block.out0, y=code_block.out1, z=code_block.out1, lacing=CrossProduct)

# group: Замена List.Map функцией List@Level
code_block_2 = CodeBlock { [1,2]; }
# note: В предыдущей версии Dynamo узел List.Map использовался для получения внутренних уровней списков. Даже если аналогичного результата можно достичь с помощью List.Map, данный способ обеспечивает больше узлов в рабочем пространстве. Для более эффективного захвата внутренних точек сетки здесь применяется List@Level. Данные точки будут использованы для создания панелей.
# Кроме того, использовался параметр «Сохранить структуру списков» для поддержания группировки исходного списка и предотвращения выравнивания. Если параметр «Сохранить структуру списков» отключен, вместо восьми объектов NurbsSurface создается один.
getItemAtIndex = List.GetItemAtIndex(list=byCoordinates@@L2, index=code_block_2)
code_block_3 = CodeBlock { [1,2]; }
# note: Списки находятся на разных уровнях, среди которых первый уровень является самым низким. Общее количество элементов, производимых данным узлом, показано в нижнем углу справа и равняется 64.
getItemAtIndex_2 = List.GetItemAtIndex(index=code_block_3)  # unwired: list
# note: Ниже находится эквивалент List.Map для применения функции List@Level, для которой требуются дополнительные узлы.
map = List.Map(f_x=getItemAtIndex_2)  # unwired: list
map_2 = List.Map(list=byCoordinates, f_x=map)

# group: Создание геометрии
# note: Выбрав наборы точек, можно создать панели.
byPoints = NurbsSurface.ByPoints(points=getItemAtIndex)
byBestFitThroughPoints = Line.ByBestFitThroughPoints(bestFitPoints=getItemAtIndex)

# group: Проверка списка с помощью List@Level и Count
# note: Узел List.Count возвращает количество элементов, представленное в каждом списке. В зависимости от выбранного уровня возвращаются различные значения. Попробуйте изменить значение третьего уровня, щелкнув стрелки рядом с ним.
# note: На третьем уровне есть восемь списков, каждый из которых содержит четыре списка. Таким образом, при выборе третьего уровня функция List.Count применяется к восьми спискам, выдавая восемь значений «4».
count = List.Count(list=byCoordinates@L3)

# group: Использование «Сохранить структуру списков»
# note: Этот узел впервые возвращает количество элементов, которое присутствует в каждом списке на втором уровне. По умолчанию результаты выравниваются в 1D-список.
count_2 = List.Count(list=byCoordinates@L2)
# note: Чтобы сохранить вложенную структуру списков, выберите параметр «Сохранить структуру списков». @@ обозначает способ сохранения структуры списков в DesignScript.
count_3 = List.Count(list=byCoordinates@@L2)

# group: Проверка списка с помощью List@Level и Flatten
# note: В качестве дополнительного примера можно легко выровнять вложенную структуру на внутренних уровнях списков, используя функцию List@Level вместе с узлом Flatten. Попробуйте изменить выравниваемый уровень, щелкнув стрелки рядом с поворотным элементом List@Level.
# note: При выборе третьего уровня восемь списков преобразуются в 1D-массив. Так как каждый из восьми списков содержит четыре элемента (которые также являются списками), это приведет к выравниванию всех списков на третьем уровне, создавая восемь списков из 16 точек.
flatten = List.Flatten(list=byCoordinates@L3)
