# Dynamo graph Core_ListLacing.dyn (Dynamo 3.1.0.3411)
# author: Dynamo Team
# Переплетение списка: изучение всех режимов переплетения списка и их демонстрация на этом графике

# group: Сведения
# note: Переплетение списков
# Переплетение — это логика, используемая в узлах Dynamo для сопоставления элементов из разных списков. Большинство узлов в Dynamo позволяют выбрать способ объединения списков данных путем установки подходящего режима переплетения.
# В каждом из этих примеров имеется два списка точек, передаваемых в узел Line.ByStartPointEndPoint. В узле, создающем линии, принимается решение о том, сколько линий и между какими наборами точек требуется построить.
# Настроить режим переплетения можно, щелкнув правой кнопкой мыши узел, в котором есть два или больше входных портов, и выбрав «Переплетение».

# group: Совет
# note: Совет: можно отобразить индекс элемента в виде метки в фоновом режиме предварительного просмотра для любого узла, составляющего геометрию. Щелкните правой кнопкой мыши и выберите «Показать метки».

# group: Совет
# note: Совет: режим переплетения узла отображается с помощью небольшого значка в правом нижнем углу экрана. Отсутствие значка означает, что переплетение в узле не выполняется.

# group: Входные данные
# note: Длинная последовательность (10 элементов)
code_block = CodeBlock { 0..9; }
code_block_2 = CodeBlock { 4; }
# note: Короткая последовательность (6 элементов)
code_block_3 = CodeBlock { 0..5; }
code_block_4 = CodeBlock { 0..9; }
code_block_5 = CodeBlock { -10; 4; }
code_block_6 = CodeBlock { 0..5; }
code_block_7 = CodeBlock { 0..9; }
code_block_8 = CodeBlock { 10; 4; }
code_block_9 = CodeBlock { 0..5; }

# group: Создание точек
# Создание двух наборов точек для коллекции (10 x 6) с целью использования в качестве входных данных узла Line.ByStartPointEndPoint
byCoordinates = Point.ByCoordinates(x=code_block, z=code_block_2)
byCoordinates_2 = Point.ByCoordinates(x=code_block_3)

# group: Переплетение самого длинного списка
# note: Переплетение самого длинного списка
# Количество выстраиваемых линий соответствует количеству элементов самого длинного списка входящих точек. Когда в узле заканчиваются точки более короткого списка, создаются копии последнего элемента в достаточном количестве для соответствия числу элементов самого длинного списка.
byStartPointEndPoint = Line.ByStartPointEndPoint(startPoint=byCoordinates, endPoint=byCoordinates_2, lacing=Longest)

# group: Создание точек
# Создание двух наборов точек для коллекции (10 x 6) с целью использования в качестве входных данных узла Line.ByStartPointEndPoint
byCoordinates_3 = Point.ByCoordinates(x=code_block_4, y=code_block_5.out0, z=code_block_5.out1)
byCoordinates_4 = Point.ByCoordinates(x=code_block_6, y=code_block_5.out0)

# group: Переплетение самого короткого списка
# note: Переплетение самого короткого списка
# Количество выстраиваемых линий соответствует количеству элементов самого короткого списка. Оставшиеся точки в более длинном списке игнорируются.
byStartPointEndPoint_2 = Line.ByStartPointEndPoint(startPoint=byCoordinates_3, endPoint=byCoordinates_4)

# group: Создание точек
# Создание двух наборов точек для коллекции (10 x 6) с целью использования в качестве входных данных узла Line.ByStartPointEndPoint
byCoordinates_5 = Point.ByCoordinates(x=code_block_7, y=code_block_8.out0, z=code_block_8.out1)
byCoordinates_6 = Point.ByCoordinates(x=code_block_9, y=code_block_8.out0)

# group: Переплетение «Векторное произведение»
# note: Режим переплетения «Векторное произведение»
# Создаются все возможные комбинации подбора пар. Для 10 точек в длинном списке и 6 в коротком в результате получится 10 x 6 = 60 линий.
byStartPointEndPoint_3 = Line.ByStartPointEndPoint(startPoint=byCoordinates_5, endPoint=byCoordinates_6, lacing=CrossProduct)
# note: Полученные линии будут храниться во вложенном списке в виде 6 списков из 10 строк или 10 списков из 6 строк (в зависимости от того, какой из этих форматов был выбран первым).
watch = Watch(byStartPointEndPoint_3)
