# Dynamo graph Core_Math.dyn (Dynamo 3.4.1.7055)
# author: Dynamo Team
# Это расширенное изучение различных математических функций и возможностей Dynamo

# group: Сведения
# note: МАТЕМАТИКА
# Математические операции в Dynamo можно выполнять с помощью узлов из библиотеки Math или Operators, а также с помощью Code Block. Ниже описывается выполнение нескольких основных математических операций с помощью каждого из этих трех методов.

# group: Основные арифметические операторы
# note: Арифметические операторы:
# +, -, *, /, %

# group: Основные логические операторы
# note: Операторы сравнения:
# <, >, <=, >=, !=, ==

# group: Логические операторы
# note: Логические операторы
# (другие операторы можно найти в библиотеке)

# group: Округление
# note: Округление

# group: Сложные математические функции
# Четыре примера достижения одного и того же результата с помощью узлов, Python, Fo
# note: Здесь представлены четыре примера работы с математическими функциями. Каждый из них начинается с сетки точек, вычисляет координаты Z для точек, а затем создает поверхность. Различаются только методы вычисления. Все методы решают одну и ту же задачу.
# 1. Узлы. Математические узлы находятся в разделе библиотеки Math и разделены на функции, логику и операторы.
# 2. Python.
# 3. Узел Code Block. Дважды щелкните в любом месте активного окна, чтобы создать узел Code Block. Синтаксис для каждой функции соответствует имени узла в Dynamo.
# ** Примечание. Изменить разрешение предварительного просмотра геометрии можно в параметрах точности визуализации: Dynamo -> «Настройки» -> «Параметры визуализации» -> «Точность визуализации».
# note: Дополнительные сведения об этом примере:
# http://dynamobim.org/math-transit/

# group: Дуга
# note: Создание дуги двумя способами: с помощью узлов и Code Block. Результаты визуализируются для большей наглядности

# group: Совет
# Выделение узлов геометрии
# note: Совет: при выборе узла, который отвечает за построение геометрии, данная геометрия будет выделена голубым цветом. Этот блок кода строит оси графика, точки на кривой и затем саму кривую. Выберите блок кода, чтобы просмотреть выстраиваемую кривую в фоновом режиме.

# group: Косинусоида
# note: Этот набор примеров демонстрирует, как построить график косинусной функции с помощью узлов и Code Block.
# В каждом примере ряд чисел принимается в качестве значений X для ряда точек, вычисляются значения Y из значений X, а затем строится линия в форме косинусоиды. Большой блок кода в конце каждого графика перемещает построенную геометрию в другую часть экрана во избежание перекрытия.

# group: Совет
# Точность визуализации
# note: Совет. Настройте параметры четкости визуализации геометрии в фоновом режиме предварительного просмотра, выбрав Dynamo -> «Настройки» -> «Параметры визуализации» -> «Точность визуализации». При высоком значении криволинейные поверхности выглядят более ровно, но их построение требует от системы большего количества ресурсов.

# group: Узлы > Исходные входные данные для списка точек
code_block = CodeBlock { -10..10..#20; }

# group: Узлы > Создание исходного списка точек и управление им
# note: Создание сетки точек.
# Обратите внимание на то, что по умолчанию установлен режим переплетения
# «Векторное произведение».
byCoordinates = Point.ByCoordinates(x=code_block, y=code_block, lacing=CrossProduct)
flatten = List.Flatten(list=byCoordinates)
X = Point.X(point=flatten)
Y = Point.Y(point=flatten)

# group: Узлы > Амплитуда
# note: Амплитуда
number_slider = DoubleSlider(5.51, range=0..10 step 0.1)  # graph input

# group: Узлы > Квадрат
number = DoubleInput(2)  # graph input
pow = Math.Pow(number=X, power=number)

# group: Узлы > Квадрат
number_2 = DoubleInput(2)  # graph input
pow_2 = Math.Pow(number=Y, power=number_2)

# group: Узлы > Частота
# note: Частота
number_slider_2 = DoubleSlider(1.724, range=0..6 step 0.1)  # graph input

# group: Узлы > Квадрат
number_3 = DoubleInput(2)  # graph input
pow_3 = Math.Pow(number=number_slider_2, power=number_3)

# group: Узлы > Последовательность математических вычислений и операций для создания «волнистой» геометрии с помощью узлов
add = pow + pow_2
add_2 = add + pow_3
sqrt = Math.Sqrt(number=add_2)
# note: Значения углов в Dynamo указываются в градусах
radiansToDegrees = Math.RadiansToDegrees(radians=sqrt)
sin = Math.Sin(angle=radiansToDegrees)
div = sin / sqrt
mul = number_slider * div

# group: Узлы > Сбор полученных точек и подготовка к окончательной визуализации
byCoordinates_2 = Point.ByCoordinates(x=X, y=Y, z=mul)
# note: Подсчет количества групп точек из исходной коллекции точек (20 x 20)
count = List.Count(list=byCoordinates)

# group: Узлы > Коллекция точек
# note: Разделение плоского списка на набор
# списков по строке
chop = List.Chop(list=byCoordinates_2, lengths=count)

# group: Узлы > Сеть кривых
# note: Создание кривых NURBS,
# проходящих через точки
byPoints = NurbsCurve.ByPoints(points=chop)

# group: Узлы > Конечная поверхность
# note: Создание поверхности
byLoft = Surface.ByLoft(crossSections=byPoints)

# group: Блок кода > Исходные входные данные для списка точек
code_block_2 = CodeBlock { -10..10..#20; }

# group: Блок кода > Создание исходного списка точек и управление им
byCoordinates_3 = Point.ByCoordinates(x=code_block_2, y=code_block_2, lacing=CrossProduct)
flatten_2 = List.Flatten(list=byCoordinates_3)
Y_2 = Point.Y(point=flatten_2)
X_2 = Point.X(point=flatten_2)

# group: Блок кода > Вспомогательная функция для перемещения геометрии
# note: Перемещение геометрии на
code_block_3 = CodeBlock(x=Y_2) { x+60; }

# group: Блок кода > Частота
number_slider_3 = DoubleSlider(1.724, range=0..5 step 0.1)  # graph input

# group: Блок кода > Амплитуда
number_slider_4 = DoubleSlider(5.51, range=0..10 step 0.1)  # graph input

# group: Блок кода > Последовательность математических вычислений и операций для создания «волнистой» геометрии с помощью Python
# note: Имена для математических способов соответствия имен узлов Dynamo, используемых в первом примере.
code_block_4 = CodeBlock(x=X_2, y=Y_2, c=number_slider_3, A=number_slider_4)
# ---------- code_block_4.designscript (6 lines) ----------
sum = Math.Pow(x,2) + Math.Pow(y,2) + Math.Pow(c,2);

num1 = Math.Sqrt(sum);
num2 = Math.Sin( Math.RadiansToDegrees(num1) );

A * num2 / num1;
# ----------------------------------------

# group: Блок кода > Сбор полученных точек и подготовка к окончательной визуализации
byCoordinates_4 = Point.ByCoordinates(x=code_block_3, y=X_2, z=code_block_4.out3)
count_2 = List.Count(list=byCoordinates_3)

# group: Блок кода > Коллекция точек
chop_2 = List.Chop(list=byCoordinates_4, lengths=count_2)

# group: Блок кода > Сеть кривых
byPoints_2 = NurbsCurve.ByPoints(points=chop_2)

# group: Блок кода > Конечная поверхность
byLoft_2 = Surface.ByLoft(crossSections=byPoints_2)

# group: Python > Исходные входные данные для списка точек
code_block_5 = CodeBlock { -10..10..#20; }

# group: Python > Создание исходного списка точек и управление им
byCoordinates_5 = Point.ByCoordinates(x=code_block_5, y=code_block_5, lacing=CrossProduct)
flatten_3 = List.Flatten(list=byCoordinates_5)
X_3 = Point.X(point=flatten_3)
Y_3 = Point.Y(point=flatten_3)

# group: Python > Вспомогательная функция для перемещения геометрии
# note: Перемещение геометрии на
code_block_6 = CodeBlock(x=X_3) { x+30; }

# group: Python > Амплитуда
number_slider_5 = DoubleSlider(5.51, range=0..10 step 0.1)  # graph input

# group: Python > Частота
number_slider_6 = DoubleSlider(1.724, range=0..5 step 0.1)  # graph input

# group: Python > Последовательность математических вычислений и операций для создания «волнистой» геометрии с помощью Python
python_script = Python(Amplitude=number_slider_5, X=X_3, Y=Y_3, Frequency=number_slider_6)  # PythonNet3
# ---------- python_script.python (27 lines) ----------
import clr
clr.AddReference('ProtoGeometry')
from Autodesk.DesignScript.Geometry import *

import math

# The inputs to this node will be stored as a list in the IN variable.
amp = IN[0]   # single value
x = IN[1]     # list
y = IN[2]     # list (expect same length as x)
c = IN[3]     # single value

# Declare an empty array of z-values
z = []

# Solve the equation for each x and y value
for index in range(len(x)):
	sum = math.pow(x[index],2) + math.pow(y[index],2) + math.pow(c,2)
	num1 = math.sqrt(sum)
	num2 = math.sin(num1)
	zVal = amp * num2 / num1
	
	# Append the answer to the list of z values
	z.append(zVal)

# Assign the z-values to the OUT variable
OUT = z
# ----------------------------------------

# group: Python > Сбор полученных точек и подготовка к окончательной визуализации
byCoordinates_6 = Point.ByCoordinates(x=code_block_6, y=Y_3, z=python_script)
count_3 = List.Count(list=byCoordinates_5)

# group: Python > Коллекция точек
chop_3 = List.Chop(list=byCoordinates_6, lengths=count_3)

# group: Python > Сеть кривых
byPoints_3 = NurbsCurve.ByPoints(points=chop_3)

# group: Python > Конечная поверхность
byLoft_3 = Surface.ByLoft(crossSections=byPoints_3)

# group: Построение косинусоиды с помощью Code Block > Входные данные
# note: Координата базовой точки
code_block_7 = CodeBlock { 25; 20; }
# note: Последовательность значений X
code_block_8 = CodeBlock { 0..10..#20; }
# note: Амплитуда
number_slider_7 = DoubleSlider(3, range=0..10 step 0.1)  # graph input
# note: Частота
number_slider_8 = DoubleSlider(36, range=0..100 step 0.1)  # graph input

# group: Построение косинусоиды с помощью Code Block > Функция кривой Cos
# Получение косинуса для заданной частоты и угла с умножением на амплитуду
code_block_9 = CodeBlock(amplitude=number_slider_7, frequency=number_slider_8, angle=code_block_8) { amplitude * Math.Cos(frequency * angle); }

# group: Построение косинусоиды с помощью Code Block > Промежуточные операции
byCoordinates_7 = Point.ByCoordinates(x=code_block_7.out0, y=code_block_7.out1)
byCoordinates_8 = Point.ByCoordinates(x=code_block_8, y=code_block_9)

# group: Построение косинусоиды с помощью Code Block > Создание и визуализация косинусоиды
code_block_10 = CodeBlock(base=byCoordinates_7, pts=byCoordinates_8)
# ---------- code_block_10.designscript (14 lines) ----------
// Make axes from base point
dimension = 10;
top = Point.ByCoordinates(base.X, base.Y + dimension/2);
bottom = Point.ByCoordinates(base.X, base.Y - dimension/2);
right = Point.ByCoordinates(base.X + 10, base.Y);
Line.ByStartPointEndPoint(bottom, top);
Line.ByStartPointEndPoint(base, right);

// Move function results to base point
vec = base.AsVector();
newPts = pts.Add(vec);

// Draw a line through the points
NurbsCurve.ByPoints(newPts);
# ----------------------------------------

# group: Построение косинусоиды с помощью узлов > Входные данные
# note: Координаты X,Y базовой точки
code_block_11 = CodeBlock { -5; 20; }
# note: Последовательность значений X
code_block_12 = CodeBlock { 0..10..#20; }
# note: Частота
number_slider_9 = DoubleSlider(36, range=0..100 step 0.1)  # graph input

# group: Построение косинусоиды с помощью узлов > Управление амплитудой
# note: Амплитуда
number_slider_10 = DoubleSlider(3, range=0..10 step 0.1)  # graph input

# group: Построение косинусоиды с помощью узлов
mul_2 = number_slider_9 * code_block_12

# group: Построение косинусоиды с помощью узлов > Функция Math.Cos
# Получение косинуса для каждого исходного числа
cos = Math.Cos(angle=mul_2)

# group (continued): Построение косинусоиды с помощью узлов
mul_3 = number_slider_10 * cos

# group: Построение косинусоиды с помощью узлов > Промежуточные операции
byCoordinates_9 = Point.ByCoordinates(x=code_block_11.out0, y=code_block_11.out1)
# note: Совет: можно включить или отключить функцию предварительного просмотра для любого узла, который отвечает за геометрию. Щелкните правой кнопкой мыши и установите или снимите флажок «Просмотр».
byCoordinates_10 = Point.ByCoordinates(x=code_block_12, y=mul_3)

# group: Построение косинусоиды с помощью узлов > Создание и визуализация косинусоиды
code_block_13 = CodeBlock(base=byCoordinates_9, pts=byCoordinates_10)  # same code as code_block_10

# group: Построение дуги с помощью узлов > Входные данные
# Создайте необходимые входные элементы:
# 1. Центр.
# 2. Радиус.
# 3. Начальный угол.
# 4. Конечный угол.
# 5. Нормаль (ось Z).
code_block_14 = CodeBlock { 0; 35; }
byCoordinates_11 = Point.ByCoordinates(x=code_block_14.out0, y=code_block_14.out1)
code_block_15 = CodeBlock { 5; 0; }
# note: Переместите ползунок для изменения длины дуги.
number_slider_11 = DoubleSlider(247.821, range=0..360 step 0.1)  # graph input
ZAxis = Vector.ZAxis()

# group: Построение дуги с помощью узлов > Создание дуги по центру, радиусу и углу
# note: Значения углов в узлах и Code Block указываются в радианах.
byCenterPointRadiusAngle = Arc.ByCenterPointRadiusAngle(center=byCoordinates_11, radius=code_block_15.out0, startAngle=code_block_15.out1, endAngle=number_slider_11, normal=ZAxis)

# group: Построение дуги с помощью узлов > Визуализация выходных данных
endPoint = Curve.EndPoint(curve=byCenterPointRadiusAngle)
byStartPointEndPoint = Line.ByStartPointEndPoint(startPoint=endPoint, endPoint=byCoordinates_11)
startPoint = Curve.StartPoint(curve=byCenterPointRadiusAngle)
byStartPointEndPoint_2 = Line.ByStartPointEndPoint(startPoint=startPoint, endPoint=byCoordinates_11)

# group: Операции с использованием узлов > -
code_block_16 = CodeBlock { 5; 2; }
sub = code_block_16.out0 - code_block_16.out1
watch = Watch(sub)

# group: Операции с использованием Code Block > -
code_block_17 = CodeBlock { 5-2; }
watch_2 = Watch(code_block_17)

# group: Операции с использованием Code Block > %
code_block_18 = CodeBlock { 5%2; }
watch_3 = Watch(code_block_18)

# group: Операции с использованием узлов > %
code_block_19 = CodeBlock { 5; 2; }
mod = code_block_19.out0 % code_block_19.out1
watch_4 = Watch(mod)

# group: Операции с использованием Code Block > <=
code_block_20 = CodeBlock { 5<=2; }
watch_5 = Watch(code_block_20)

# group: Операции с использованием Code Block > >
code_block_21 = CodeBlock { 5>2; }
watch_6 = Watch(code_block_21)

# group: Операции с использованием узлов > <=
code_block_22 = CodeBlock { 5; 2; }
le = code_block_22.out0 <= code_block_22.out1
watch_7 = Watch(le)

# group: Операции с использованием узлов > >
code_block_23 = CodeBlock { 5; 2; }
gt = code_block_23.out0 > code_block_23.out1
watch_8 = Watch(gt)

# group: Построение дуги с помощью Code Block > Входные данные
# Создайте необходимые входные элементы:
# 1. Центр.
# 2. Конечный угол
code_block_24 = CodeBlock { 15; 35; }
byCoordinates_12 = Point.ByCoordinates(x=code_block_24.out0, y=code_block_24.out1)
number_slider_12 = DoubleSlider(126.947, range=0..360 step 0.1)  # graph input

# group: Построение дуги с помощью Code Block > Создание дуги по центру, радиусу и углу
code_block_25 = CodeBlock(center=byCoordinates_12, endAngle=number_slider_12) { Arc.ByCenterPointRadiusAngle(center,5,0,endAngle,Vector.ZAxis()); }

# group: Построение дуги с помощью Code Block > Визуализация выходных данных
startPoint_2 = Curve.StartPoint(curve=code_block_25)
byStartPointEndPoint_3 = Line.ByStartPointEndPoint(startPoint=startPoint_2, endPoint=byCoordinates_12)
endPoint_2 = Curve.EndPoint(curve=code_block_25)
byStartPointEndPoint_4 = Line.ByStartPointEndPoint(startPoint=endPoint_2, endPoint=byCoordinates_12)

# group: Округление с помощью узлов > Входные данные
code_block_26 = CodeBlock { 3.14159; }
code_block_27 = CodeBlock { 3; }

# group: Округление с помощью узлов > Округление в меньшую сторону
floor = Math.Floor(number=code_block_26)
watch_9 = Watch(floor)

# group: Округление с помощью узлов > Округление в большую сторону
ceiling = Math.Ceiling(number=code_block_26)
watch_10 = Watch(ceiling)

# group: Округление с помощью узлов > Округление в большую или меньшую сторону
# В зависимости от того, что ближе
round = Math.Round(number=code_block_26)
watch_11 = Watch(round)

# group: Округление с помощью узлов > Округление до указанного числа знаков
round_2 = Math.Round(number=code_block_26, digits=code_block_27)
watch_12 = Watch(round_2)

# group: Округление с помощью Code Block > Входные данные
code_block_28 = CodeBlock { 3.14159; }

# group: Округление с помощью Code Block > Округление в меньшую сторону
code_block_29 = CodeBlock(num=code_block_28) { Math.Floor(num); }
watch_13 = Watch(code_block_29)

# group: Округление с помощью Code Block > Округление в большую сторону
code_block_30 = CodeBlock(num=code_block_28) { Math.Ceiling(num); }
watch_14 = Watch(code_block_30)

# group: Округление с помощью Code Block > Округление в большую или меньшую сторону
# В зависимости от того, что ближе
code_block_31 = CodeBlock(num=code_block_28) { Math.Round(num); }
watch_15 = Watch(code_block_31)

# group: Округление с помощью Code Block > Округление до указанного числа знаков
# Описание <Дважды нажмите здесь, чтобы изменить описание группы>
code_block_32 = CodeBlock(num=code_block_28) { Math.Round(num,3); }
watch_16 = Watch(code_block_32)

# group: Операции с использованием Code Block > == (равно)
code_block_33 = CodeBlock { true == false; }
watch_17 = Watch(code_block_33)

# group: Операции с использованием Code Block > Нет
code_block_34 = CodeBlock { !true; }
watch_18 = Watch(code_block_34)

# group: Операции с использованием Code Block > && (и)
code_block_35 = CodeBlock { true && false; }
watch_19 = Watch(code_block_35)

# group: Операции с использованием Code Block > || (или)
code_block_36 = CodeBlock { true || false; }
watch_20 = Watch(code_block_36)

# group: Операции с использованием узлов > == (равно)
boolean = BoolSelector(true)  # graph input
boolean_2 = BoolSelector(false)  # graph input
eq = boolean == boolean_2
watch_21 = Watch(eq)

# group: Операции с использованием узлов > || (или)
boolean_3 = BoolSelector(true)  # graph input
boolean_4 = BoolSelector(false)  # graph input
or_ = boolean_3 || boolean_4
watch_22 = Watch(or_)

# group: Операции с использованием узлов > && (и)
boolean_5 = BoolSelector(true)  # graph input
boolean_6 = BoolSelector(false)  # graph input
and_ = boolean_5 && boolean_6
watch_23 = Watch(and_)

# group: Операции с использованием узлов > Нет
boolean_7 = BoolSelector(true)  # graph input
not_ = Not(x=boolean_7)
watch_24 = Watch(not_)
