# Dynamo graph Core_PassingFunctions.dyn (Dynamo 3.1.0.3411)
# author: Dynamo Team
# Демонстрация передачи функции в Dynamo

# group: Сведения
# note: Передача функций
# Dynamo представляет собой функциональный язык, что означает, что действия могут рассматриваться так же, как и ОБЪЕКТЫ. Большинство узлов в Dynamo могут быть преобразованы в функции и применяться четким образом к набору данных.
# Создание функции и ее передача подобны выдаче команды «Выполнять в течение 20 минут!», только при этом исполнителя можно определить позже.
# На данном примере представлены сетки окружностей в сложной конструкции. Команда для выбора набора окружностей используется напрямую, а затем передается в виде функции к нижним уровням данных с целью получения результат другого рода.

# group: Исходные входные данные
# Создание матрицы точек 5 x 8
code_block = CodeBlock { 0..#8..4; }
code_block_2 = CodeBlock { 0..#5..4; }
byCoordinates = Point.ByCoordinates(x=code_block, y=code_block_2, lacing=CrossProduct)

# group: Построение матрицы из окружностей
# note: Этот список точек организован в виде иерархической структуры — это перечень списков. Сетка была создана с 8-ю точками в направлении X и с 5-ю в направлении Y. Этот список содержит 8 списков с 5-ю элементами, а именно списки столбцов точек.
watch = Watch(byCoordinates)
code_block_3 = CodeBlock { 1.5; }
# note: Построение окружности вокруг каждой точки.
byCenterPointRadius = Circle.ByCenterPointRadius(centerPoint=watch, radius=code_block_3)

# group: Выбор второго и третьего СПИСКОВ
# Передача функции
code_block_4 = CodeBlock { 1..2; }
# note: Во вложенном списке окружностей выбраны элементы {1,2}. В узлах Dynamo списки обрабатываются от внешнего элемента к внутреннему или сверху вниз.
# Если выбрать в списке элементы 1 и 2, списки #1 и #2 будут возвращены из исходной структуры вложенных списков.
getItemAtIndex = List.GetItemAtIndex(list=byCenterPointRadius, index=code_block_4)

# group: Выдавливание ВВЕРХ
# Итоговые цилиндры
# note: Выбранные данные все еще находятся в этой же конструкции перед ее выбором посредством сопоставления.
watch_2 = Watch(getItemAtIndex)
code_block_5 = CodeBlock { 3; }
# note: Этот список окружностей будет выдавлен вверх.
extrude = Curve.Extrude(curve=watch_2, distance=code_block_5)

# group: Выбор второго и третьего ЭЛЕМЕНТОВ из КАЖДОГО СПИСКА
# Передача функции
code_block_6 = CodeBlock { 1..2; }
# note: Элемент List@Level позволяет получить элементы #1 и #2 из КАЖДОГО списка (вместо первых двух списков из выходного значения узла), выбрав L2 в порте ввода List.GetItemAtIndex.
# Обратите внимание, что этот элемент использует функцию List.Map —​ метода доступа к внутренним уровням входных списков в предыдущих версиях Dynamo.
getItemAtIndex_2 = List.GetItemAtIndex(list=byCenterPointRadius@L2, index=code_block_6)

# group: Выдавливание ВНИЗ
# Итоговые цилиндры
watch_3 = Watch(getItemAtIndex_2)
code_block_7 = CodeBlock { -3; }
# note: Этот список окружностей будет выдавлен вниз.
extrude_2 = Curve.Extrude(curve=watch_3, distance=code_block_7)
