# Dynamo graph Core_Python.dyn (Dynamo 4.1.0.2940)
# author: Dynamo Team
# Использование узла Python в Dynamo

# group: Сведения
# note: PYTHON
# Dynamo поддерживает CPython посредством одного из двух типов узлов Python. (Второй тип узла Python, не показанный здесь, может читать сценарий из внешнего исполняемого файла.)
# Дважды щелкните узел Python, чтобы просмотреть содержащийся в нем сценарий.
# Ввод содержится в массиве IN. Вывод должен быть назначен переменной OUT. Вывод может представлять собой одно значение или сам массив.

# group: Использование узла Python для применения режима управления знаком к списку
# note: В данном примере выполняется сложение или вычитание всех элементов в списке. К входным данным здесь относится число, знак которого определяет характер операции (сложение или вычитание), и список чисел.

# group: Выбор положительного числа, 0 или отрицательного числа
# Описание <Дважды нажмите здесь, чтобы изменить описание группы>
# note: Выберите знак для операции
#     число < 0      вычесть из каждого
#     число = 0      0
#     число > 0      прибавить к каждому
integer_slider = IntegerSlider(1, range=-1..2 step 1)

# group: Создание входного списка
# note: Создать список
code_block = CodeBlock { 0..10; }
watch = Watch(code_block)

# group: Python
# Применение режима управления знаком
# note: Выводом из OUT будет массив, в котором первый элемент представляет собой единое значение, а второй — список значений. Такая структура данных описана в самом определении Python. Указание данных массива позволяет отправлять любое количество выводных данных на график Dynamo.
python_script = Python(Sign=integer_slider, List=watch)  # PythonNet3
# ---------- python_script.python (31 lines) ----------
# Python script to find add or subtract a series of numbers. 

# Boiler-plate import statments included out-of-the-box
import clr
clr.AddReference('ProtoGeometry')
from Autodesk.DesignScript.Geometry import *

# The inputs to this node will be stored as a list in the IN variable.
sign = IN[0]  # -1 for subtract all, 0 for do nothing, 1 for add all
nums = IN[1]  # List of numbers to subtract or add

partials = [] # Empty array to contain partial sums or differences
result = 0    # Initialize the sum or difference to 0

# Loop through each item and add it or subtract it from the result.
for index in range(len(nums)):
	if sign > 0:
		result = result + nums[index]
		partials.append(result)
	elif sign == 0:
		partials.append(result)
		continue
	else:
		result = result - nums[index]
		partials.append(result)

# Assign the output to the OUT variable
#OUT = results  # Use this to output only the result.
OUT = []
OUT.append(result)
OUT.append(partials)
# ----------------------------------------

# group: Итоговый список
code_block_2 = CodeBlock { 1; }
getItemAtIndex = List.GetItemAtIndex(list=python_script, index=code_block_2)
# note: Последовательность частичных результатов.
watch_2 = Watch(getItemAtIndex)

# group: Итоговая сумма
code_block_3 = CodeBlock { 0; }
getItemAtIndex_2 = List.GetItemAtIndex(list=python_script, index=code_block_3)
# note: Общий результат.
watch_3 = Watch(getItemAtIndex_2)

# group: Создание геометрии Python
# note: На данном примере с Python входные данные отсутствуют. Здесь демонстрируется способ создания геометрии с использованием библиотеки первичной геометрии Dynamo. Так как узел Python создает видимую геометрию, то при его выборе, как и любого другого узла, геометрия будет выделена.
python_script_2 = Python()  # PythonNet3
# ---------- python_script_2.python (24 lines) ----------
import clr
clr.AddReference('ProtoGeometry')
from Autodesk.DesignScript.Geometry import *
#The inputs to this node will be stored as a list in the IN variable.
dataEnteringNode = IN

p1 = Point.ByCoordinates(0, 0, 0);
p2 = Point.ByCoordinates(-10, -10, -10);

l = Line.ByStartPointEndPoint(p1, p2);

pts = [
	Point.ByCoordinates(0, 0, 0),
	Point.ByCoordinates(10, 10, 0),
	Point.ByCoordinates(20, 0, 0),
	Point.ByCoordinates(30, 10, 0),
	Point.ByCoordinates(40, 0, 0) ]
	
spline = NurbsCurve.ByPoints(pts)

surf = spline.Extrude(Vector.ByCoordinates(0, 0, 1), 10)

#Assign your output to the OUT variable
OUT = [l, spline, surf]
# ----------------------------------------

# group: Просмотр итогового вывода
# note: Совет: используйте Code Block для доступа
# к определенным элементам в списке.
code_block_4 = CodeBlock(output=python_script_2) { output[0]; output[1]; output[2]; }
watch_4 = Watch(code_block_4.out2)
watch_5 = Watch(code_block_4.out0)
watch_6 = Watch(code_block_4.out1)
