# Dynamo graph Core_RangeSyntax.dyn (Dynamo 3.0.0.6964)
# author: Dynamo Team
# Этот график предоставляет несколько способов создания последовательности равномерно расположенных чисел или символов.

# group: Сведения
# note: Синтаксис диапазона
# Существует несколько способов создания списков в виде последовательностей чисел или символов.
# Последовательности могут пригодиться при создании массивов элементов, итераций, а также для подготовки к использованию различных функций и формул.

# group: Использование Code Block
# note: start..end..step
# От 0 до 10 с шагом 2
# Этот метод эквивалентен использованию узла Range
code_block = CodeBlock { 0..10..2; }
watch = Watch(code_block)
# note: start..end
# Если шаг не задан, принимается значение 1.
# Этот метод идентичен использованию узла Range
# note: Используйте синтаксис диапазона в узле Code Block. Существует несколько способов создания последовательности чисел (или символов):
#         start..end..step
#         start..end..#amount
#         start..#amount..interval
# start = число или символ, с которого начинается последовательность
# end = число или символ, которым заканчивается последовательность
# step = разница между двумя последовательными числами или символами
# amount = количество чисел или символов в последовательности
code_block_2 = CodeBlock { 0..10; }
watch_2 = Watch(code_block_2)
# note: start..end..#amount
# От 0 до 10 в 3 шага
code_block_3 = CodeBlock { 0..10..#3; }
watch_3 = Watch(code_block_3)
# note: start..#amount..interval
# 10 шагов, начиная с 0, каждый шаг равен 3
# Этот метод эквивалентен использованию узла Sequence
code_block_4 = CodeBlock { 0..#10..3; }
watch_4 = Watch(code_block_4)

# group: Использование Code Block с динамическим вводом
integer_slider = IntegerSlider(7, range=0..10 step 1)
# note: Замена значения на переменную и использование регулятора для динамического управления длиной списка.
code_block_5 = CodeBlock(howMany=integer_slider) { 0..#howMany..3; }
watch_5 = Watch(code_block_5)

# group: Использование узла Sequence
number = DoubleInput(0)
number_slider = DoubleSlider(8, range=0..10 step 0.1)
number_2 = DoubleInput(2)
# note: Используйте узел Sequence, если количество элементов в списке и длина каждого шага известны. Последний результат в списке не указывается предварительно, а рассчитывается на основе других входных данных.
# Пример: проектирование парковки с пространством для 8 автомобилей и известной шириной каждого парковочного места. Общая ширина всех парковочных мест зависит от каждого значения ширины и количества мест.
sequence = Sequence(start=number, amount=number_slider, step=number_2, lacing=Longest)
watch_6 = Watch(sequence)

# group: Использование узла Range
number_3 = DoubleInput(0)
number_4 = DoubleInput(10)
number_slider_2 = DoubleSlider(1.75, range=0..10 step 0.1)
# note: Используйте узел Range, если известны начало и конец последовательности. Количество элементов в итоговом списке не указывается предварительно, а рассчитывается на основе других входных данных.
# Следует отметить, что последний элемент в списке может не соответствовать входному параметру end, если значение параметра step выходит за пределы end с превышением на дополнительный шаг.
# Увеличение значения step между заданными значениями start и end может привести к уменьшению количества элементов, и наоборот, уменьшение step может увеличить длину списка.
range = Range(start=number_3, end=number_4, step=number_slider_2, lacing=Longest)
watch_7 = Watch(range)

# group: Использование узла Range со строками
string = StringInput("A")
string_2 = StringInput("P")
code_block_6 = CodeBlock { 1; }
# note: Узел Range также можно использовать для создания последовательностей символов.
range_2 = Range(start=string, end=string_2, step=code_block_6, lacing=Longest)
watch_8 = Watch(range_2)

# group: Использование узла Sequence со строками
string_3 = StringInput("A")
code_block_7 = CodeBlock { 20; }
# note: Использование узла Sequence для создания последовательности букв в алфавитном порядке
sequence_2 = Sequence(start=string_3, amount=code_block_7)
watch_9 = Watch(sequence_2)

# note: Использование последовательности значений для создания ряда точек
byCoordinates = Point.ByCoordinates(x=code_block_5)
