# Dynamo graph Core_Strings.dyn (Dynamo 3.4.1.7055)
# author: Dynamo Team
# Этот график демонстрирует действия, которые можно выполнить в отношении строк.

# group: Сведения
# note: СТРОКИ
# Этот набор примеров демонстрирует некоторые действия, которые можно выполнить в отношении строк. Дополнительные узлы для операций со строками можно найти в библиотеке узлов в категории String

byCoordinates = Point.ByCoordinates()
code_block = CodeBlock { 5; }
# note: Создание объекта — окружность
byCenterPointRadius = Circle.ByCenterPointRadius(centerPoint=byCoordinates, radius=code_block)

# group: Преобразование объекта в строку
# note: Преобразование объекта в строку с описанием данного объекта.
string_from_object = FromObject(obj=byCenterPointRadius)

watch = Watch(string_from_object)

# group: Разделение строки с помощью разделителей
code_block_2 = CodeBlock { "("; ")"; " "; "="; ","; }
# note: Разделение строки на части путем указания одного или нескольких символов-разделителей. Каждый разделитель может состоять из одного или нескольких символов.
split = String.Split(string=watch, separator0=code_block_2.out0, separator1=code_block_2.out1, separator2=code_block_2.out2, separator3=code_block_2.out3, separator4=code_block_2.out4)

watch_2 = Watch(split)

# group: Проверка того, содержит ли строка подстроку
code_block_3 = CodeBlock { "."; }
# note: Найдите строку, содержащую другую строку.
contains = String.Contains(string=watch_2, searchFor=code_block_3)

watch_3 = Watch(contains)

# group: Создание строки
# note: Используйте Code Block для создания строки. Знаки "" отделяют строковое значение.
code_block_4 = CodeBlock { "Few things are harder to put up with than a good example."; }

# group: Изменение на ВЕРХНИЙ РЕГИСТР
string = StringInput(" - Mark Twain")
# note: Измените регистр строки
toUpper = String.ToUpper(string=string)
watch_4 = Watch(toUpper)

# group: Соединение
# note: Скрепление двух строк с целью выполнения так называемого объединения.
concat = String.Concat(string0=code_block_4, string1=watch_4)

watch_5 = Watch(concat)

# group: Замена символов в строке
code_block_5 = CodeBlock { "put"; }
code_block_6 = CodeBlock { "come"; }
# note: Замена всех вхождений подстроки на замещающую строку.
replace = String.Replace(string=watch_5, searchFor=code_block_5, replaceWith=code_block_6)

watch_6 = Watch(replace)

# group: Поиск подстроки в строке
code_block_7 = CodeBlock { " to"; }
# note: Поиск места, где в строке встречается определенная подстрока. Результатом является индекс, где начинается подстрока.
indexOf = String.IndexOf(string=watch_6, searchFor=code_block_7)
watch_7 = Watch(indexOf)

# group: Длина строки
# note: Найдите общее количество символов в строке.
length = String.Length(string=watch_6)
watch_8 = Watch(length)

# note: Вычитание первой части строки из общей длины строки
sub = watch_8 - watch_7

# group: Удаление символов
# note: Удаление определенного числа символов из строки.
remove = String.Remove(string=watch_6, startIndex=watch_7, count=sub)

# group: Подсчет вхождений
watch_9 = Watch(remove)
code_block_8 = CodeBlock { "ar"; }
# note: Подсчет вхождений подстроки в строке.
countOccurrences = String.CountOccurrences(string=watch_9, searchFor=code_block_8)
watch_10 = Watch(countOccurrences)

# group: Создание строки
# note: Если строка содержит символ ", используйте знак перехода \ перед символом ", чтобы этот символ рассматривался как часть строки, а не как конец строки.
code_block_9 = CodeBlock { "There is no \"I\" in Team"; }
watch_11 = Watch(code_block_9)

диапазон_чисел = CodeBlock { 2..101; }

# group: Соединение строк с помощью Add
code_block_10 = CodeBlock { " Dalmatians"; }
# note: Операция Add автоматически преобразует числа в строки и выполняет соединение
add = диапазон_чисел + code_block_10
watch_12 = Watch(add)

# group: Преобразование объекта в строку
# note: В некоторых случаях необходимо сначала преобразовать объект в строку
string_from_object_2 = FromObject(object=диапазон_чисел)
watch_13 = Watch(string_from_object_2)
type = Object.Type(object=string_from_object_2)
watch_14 = Watch(type)

# group: Преобразование строки в число
code_block_11 = CodeBlock { "101 Dalmatians"; }
code_block_12 = CodeBlock { " "; }
# note: Разделение строки на слова с использованием пробела в качестве разделителя
split_2 = String.Split(string=code_block_11, separator0=code_block_12)
# note: Получение первого элемента списка
firstItem = List.FirstItem(list=split_2)
# note: Преобразование строки в число
toNumber = String.ToNumber(string=firstItem)
watch_15 = Watch(toNumber)
type_2 = Object.Type(object=toNumber)
watch_16 = Watch(type_2)

# group: Преобразование строк в числа
# note: Использование логического списка в качестве маски для фильтра с целью получения всех чисел в списке
filterByBoolMask = List.FilterByBoolMask(list=watch_2, mask=contains)
# note: Преобразование строк в числа
toNumber_2 = String.ToNumber(string=filterByBoolMask.in)

watch_17 = Watch(filterByBoolMask.in)
