# Dynamo graph Geometry_Curves.dyn (Dynamo 3.1.0.3411)
# author: Dynamo Team
# Пример графика, демонстрирующий создание базовых криволинейных примитивов: отрезка, сложной кривой, незамкнутой и замкнутой NURBS-кривой

# group: Сведения
# note: Этот график демонстрирует создание базовых криволинейных примитивов: отрезка, сложной кривой, незамкнутой и замкнутой NURBS-кривой

# group: Исходные входные данные
number = DoubleInput(5)
number_2 = DoubleInput(10)
number_3 = DoubleInput(15)

# group: Исходные 4 точки
byCoordinates = Point.ByCoordinates()
byCoordinates_2 = Point.ByCoordinates(y=number)
byCoordinates_3 = Point.ByCoordinates(x=number_2, y=number_2)
byCoordinates_4 = Point.ByCoordinates(x=number_3)

# group: Список из 4 точек
create = List.Create(item0=byCoordinates, item1=byCoordinates_2, item2=byCoordinates_3, item3=byCoordinates_4)

# group: NURBS-кривая
# note: Создание NURBS-кривой по 4 точкам
byPoints = NurbsCurve.ByPoints(points=create)

# group: Отрезок
# note: Одиночная прямая по 2 точкам
byStartPointEndPoint = Line.ByStartPointEndPoint(startPoint=byCoordinates, endPoint=byCoordinates_2)

length = Curve.Length(curve=byStartPointEndPoint)

# group: NURBS-кривая — замкнутая
boolean = BoolSelector(true)
# note: Создание замкнутой NURBS-кривой в рамках ограничивающих точек
byControlPoints = NurbsCurve.ByControlPoints(points=create, closeCurve=boolean)

# group: Сложная кривая
# Описание <Дважды нажмите здесь, чтобы изменить описание группы>
# note: Создание прямой сложной кривой через набор точек
# note: Создать примечание
byPoints_2 = PolyCurve.ByPoints(points=create)

# group: Действия и запросы
code_block = CodeBlock { 0..1..#20; }
# note: Кривые, сложные кривые (совокупности кривых), NURBS и все линии являются производными кривых, поэтому все действия и запросы, относящиеся к кривым, распространяются и на остальные перечисленные элементы.
pointAtParameter = Curve.PointAtParameter(curve=byPoints_2, param=code_block)
