# Dynamo graph Geometry_Points.dyn (Dynamo 3.1.0.3411)
# author: Dynamo Team
# Создание массива точек

# group: Исходные входные данные
number_slider = DoubleSlider(6.4, range=0..10 step 0.1)

# group: Одна точка
# note: Основные геометрические элементы имеют значения по умолчанию для числовых входных данных. Просмотрите значения по умолчанию, наведя указатель на порт ввода узла
byCoordinates = Point.ByCoordinates(z=number_slider)

# group: Просмотр результатов
# note: После нажатия кнопки «Запуск» или при включенном параметре «Автоматическое выполнение процесса» геометрический объект отображается в области «Фоновый просмотр», узле Watch 3D или в виде данных в узле Watch. При выборе узла фон элементов выделяется
watch_3d = Watch3D(byCoordinates)

# group: Исходные входные данные
number = DoubleInput(0)
number_2 = DoubleInput(10)
number_3 = DoubleInput(1)

# group: Диапазон чисел
# note: Массивы геометрии можно создавать при использовании последовательностей, диапазонов и списков
range = Range(start=number, end=number_2, step=number_3, lacing=Longest)

# group: Матрица точек
# note: Можно создать 1-, 2- и 3-мерные массивы путем передачи диапазонов в порты для точек x, y и z, после чего изменить свойства переплетения в контекстном меню узла. Обратите внимание на результат при выборе параметра переплетения «Векторное произведение»
byCoordinates_2 = Point.ByCoordinates(x=range, y=range, lacing=CrossProduct)

watch = Watch(byCoordinates)

# group: Преобразование точки в вектор
# Описание <Дважды нажмите здесь, чтобы изменить описание группы>
# note: Некоторые элементы легко преобразуются в другие
asVector = Point.AsVector(point=watch)

# group: Перемещение матрицы на точку в качестве вектора
# note: Производные элементы можно создавать при помощи инструментов в подкатегории объекта «Действия»
add = Point.Add(point=byCoordinates_2, vectorToAdd=asVector)

# group: Просмотр координаты Z для точки
# note: Информацию из геометрии можно извлечь с помощью узлов подкатегории Query каждой группы узлов (рядом с символом вопросительного знака)
Z = Point.Z(point=byCoordinates)
