# Dynamo graph Geometry_Solids.dyn (Dynamo 3.1.0.3411)
# author: Dynamo Team
# Пример графика Dynamo, демонстрирующий создание тела с помощью лофта и управление телом (добавление и вычитание)

# group: Исходные точки для первой группы кривых
byCoordinates = Point.ByCoordinates()
number = DoubleInput(10)
byCoordinates_2 = Point.ByCoordinates(x=number)
byCoordinates_3 = Point.ByCoordinates(y=number)

# group: Дополнительная точка для второй группы кривых
number_2 = DoubleInput(5)
byCoordinates_4 = Point.ByCoordinates(z=number_2)

# group: Создание исходных кривых для нижней основы
byStartPointEndPoint = Line.ByStartPointEndPoint(startPoint=byCoordinates, endPoint=byCoordinates_2)
byThreePoints = Arc.ByThreePoints(firstPoint=byCoordinates, secondPoint=byCoordinates_4, thirdPoint=byCoordinates_2)

# group: Создание нижней основы
create = List.Create(item0=byStartPointEndPoint, item1=byThreePoints)
byJoinedCurves = PolyCurve.ByJoinedCurves(curves=create)

# group: Дополнительная точка для третьей группы кривых
number_3 = DoubleInput(15)
byCoordinates_5 = Point.ByCoordinates(x=number_3, y=number_3)

# group: Дополнительная точка для четвертой группы кривых
number_4 = DoubleInput(5)
number_5 = DoubleInput(10)
byCoordinates_6 = Point.ByCoordinates(x=number_4, y=number_5, z=number_5)

# group: Создание исходных кривых для верхней основы
byStartPointEndPoint_2 = Line.ByStartPointEndPoint(startPoint=byCoordinates_3, endPoint=byCoordinates_5)
byThreePoints_2 = Arc.ByThreePoints(firstPoint=byCoordinates_3, secondPoint=byCoordinates_6, thirdPoint=byCoordinates_5)

# group: Создание верхней основы
create_2 = List.Create(item0=byStartPointEndPoint_2, item1=byThreePoints_2)
byJoinedCurves_2 = PolyCurve.ByJoinedCurves(curves=create_2)

# group: Объединение базовых кривых в список
create_3 = List.Create(item0=byJoinedCurves, item1=byJoinedCurves_2)

# group: Лофт
# note: Для большинства тел существует несколько методов создания. На этих примерах показаны замкнутые профили в качестве основы. Сложные поверхности могут быть сшиты, и при этом доступны многие простые элементы (поверхности, кубоиды, конусы, и т. д.)
byLoft = Solid.ByLoft(crossSections=create_3)

# group: Объем
# note: Можно узнать объем лофта, отобразив его в качестве замкнутой твердотельной геометрии
volume = Solid.Volume(solid=byLoft)

# group: Дополнительная точка для дополнительной геометрии лофта
number_6 = DoubleInput(-2)
number_7 = DoubleInput(5)
byCoordinates_7 = Point.ByCoordinates(x=number_6, y=number_7)

# group: Объединение точек в список
create_4 = List.Create(item0=byCoordinates, item1=byCoordinates_7, item2=byCoordinates_3)

# group: Создание дополнительной базовой кривой
# Описание <Дважды нажмите здесь, чтобы изменить описание группы>
# note: На этот раз создайте NURBS-кривую из группы точек
byPoints = NurbsCurve.ByPoints(points=create_4)

# group: Лофт +
# note: Совет: снимите флажок «Просмотр» в контекстном меню узла, чтобы исключить элементы из режима отображения
byLoft_2 = Solid.ByLoft(crossSections=create_3, guideCurves=byPoints)

# group: Геометрия +
code_block = CodeBlock { Vector.ByCoordinates(-20,0,0); }
# note: Перемещение геометрии для визуализации вывода
translate = Geometry.Translate(geometry=byLoft_2, direction=code_block)

# group: Подготовка компонентов для обрезки твердотельной геометрии
# note: Толщина
code_block_2 = CodeBlock { 0; }
# note: Совет: снимите флажок «Просмотр» в контекстном меню узла, чтобы исключить элементы из режима отображения
thinShell = Solid.ThinShell(solid=byLoft, internalFaceThickness=code_block_2)
code_block_3 = CodeBlock { Vector.ByCoordinates(20,0,0); }
# note: Перемещение геометрии в направлении оси X на 20 единиц
translate_2 = Geometry.Translate(geometry=thinShell, direction=code_block_3)
code_block_4 = CodeBlock { Point.ByCoordinates(0,0,5); }
ZAxis = Vector.ZAxis()
# note: Создание плоскости, проходящей через тело, с помощью которой выполняется вырез
byOriginNormal = Plane.ByOriginNormal(origin=code_block_4, normal=ZAxis)
# note: Эта точка определяет, какую часть тела следует обрезать
code_block_5 = CodeBlock { Point.ByCoordinates(10,10,10); }

# group: Лофт -
# note: Геометрические логические операции («Пересечение», «Разница», «Соединение» и т. д.) доступны в категории «Геометрия».
trim = Geometry.Trim(geometry=translate_2, other=byOriginNormal, pick=code_block_5)
