# Dynamo graph Geometry_Surfaces.dyn (Dynamo 3.1.0.3411)
# График Dynamo, демонстрирующий основные способы создания поверхностей: выдавливание, лофт и сдвиг.

# group: Сведения
# note: График Dynamo, демонстрирующий основные способы создания поверхностей: выдавливание, лофт и сдвиг

# group: Ввод
number = DoubleInput(10)
number_2 = DoubleInput(-10)
byCoordinates = Point.ByCoordinates(x=number, y=number_2)
byCoordinates_2 = Point.ByCoordinates(y=number_2)

# group: Отрезок
byStartPointEndPoint = Line.ByStartPointEndPoint(startPoint=byCoordinates, endPoint=byCoordinates_2)

# group: Ввод
byCoordinates_3 = Point.ByCoordinates()

# group: Ввод
number_3 = DoubleInput(5)
byCoordinates_4 = Point.ByCoordinates(z=number_3)

# group: Ввод
number_4 = DoubleInput(10)
byCoordinates_5 = Point.ByCoordinates(x=number_4)
byCoordinates_6 = Point.ByCoordinates(y=number_4)

# group: Дуга
byThreePoints = Arc.ByThreePoints(firstPoint=byCoordinates_3, secondPoint=byCoordinates_4, thirdPoint=byCoordinates_5)

# group: Лофт
create = List.Create(item0=byStartPointEndPoint, item1=byThreePoints)
# note: Используя два набора кривых, можно создать между ними геометрию лофта
byLoft = Surface.ByLoft(crossSections=create)

# group: Расчет площади лофта
area = Surface.Area(surface=byLoft)
watch = Watch(area)

# group: Ввод
number_5 = DoubleInput(5)
number_6 = DoubleInput(10)
byCoordinates_7 = Point.ByCoordinates(x=number_5, y=number_6, z=number_6)

# group: Ввод
number_7 = DoubleInput(15)
byCoordinates_8 = Point.ByCoordinates(x=number_7, y=number_7)

# group: Дуга
byThreePoints_2 = Arc.ByThreePoints(firstPoint=byCoordinates_6, secondPoint=byCoordinates_7, thirdPoint=byCoordinates_8)

# group: Ввод
number_8 = DoubleInput(-5)
number_9 = DoubleInput(5)
byCoordinates_9 = Point.ByCoordinates(x=number_8, y=number_9)

# group: Дуга
byThreePoints_3 = Arc.ByThreePoints(firstPoint=byCoordinates_3, secondPoint=byCoordinates_9, thirdPoint=byCoordinates_6)

# group: Сдвиг
# note: Для большинства поверхностей существует несколько методов создания. Поверхности, сложные поверхности (коллекции поверхностей) и поверхности NURBS можно создать на основе точек и кривых, а также и на основе других поверхностей и тел
bySweep2Rails = Surface.BySweep2Rails(path=byThreePoints_2, guideRail=byThreePoints, profile=byThreePoints_3)

# group: Объединение лофта и сдвига
create_2 = List.Create(item0=byLoft, item1=bySweep2Rails)
# note: Поверхности соединены в форме сложных поверхностей и могут оцениваться как единое целое
byJoinedSurfaces = PolySurface.ByJoinedSurfaces(surfaces=create_2)

# group: Расчет объединенной площади лофта и сдвига
area_2 = Surface.Area(surface=byJoinedSurfaces)
watch_2 = Watch(area_2)

# group: Расчет площади сдвига
area_3 = Surface.Area(surface=bySweep2Rails)
watch_3 = Watch(area_3)

# group: Извлечение точек из поверхности и их использование
code_block = CodeBlock { 0..1..0.1; }
# note: Ребра, точки и другие элементы можно создать на основе поверхностей, используя действия в соответствии с особенностями геометрии
pointAtParameter = Surface.PointAtParameter(surface=bySweep2Rails, u=code_block, v=code_block, lacing=CrossProduct)
# note: Создайте NURBS-поверхность с помощью извлеченных параметров (точек).
# Скройте остальную геометрию, чтобы увидеть результат, как показано ниже.
byControlPoints = NurbsSurface.ByControlPoints(controlVertices=pointAtParameter)
watch_3d = Watch3D(byControlPoints)

# group: Выдавливание
code_block_2 = CodeBlock { 10; }
# note: Базовое выдавливание из заданной кривой
extrude = Curve.Extrude(curve=byThreePoints_2, distance=code_block_2)
