# Dynamo graph ImportExport_CSV to Stuff.dyn (Dynamo 3.1.0.3411)
# author: Dynamo Team
# Создание геометрии на основе разобранных данных CSV

# group: Исходные входные данные helix.csv
# note: Перейдите к файлу CSV, который содержит числа,
# относящиеся к пространству координат XYZ.
file_path = Filename("..\..\Data\helix.csv")

# group: Чтение файла
fromPath = FileObject(path=file_path)  # "File.FromPath"
readText = FileSystem.ReadText(file=fromPath)

# group: Разбор данных CSV
string = StringInput("\n")
# note: Разбиение строки
# Возврат каретки<enter>
split = String.Split(string=readText, separator0=string)
string_2 = StringInput(",")
# note: Разбиение строки с помощью запятой
split_2 = String.Split(string=split, separator0=string_2)
# note: В файлах CSV поддерживаются строки, но не числа
toNumber = String.ToNumber(string=split_2)
# note: Группа компонентов X, Y и Z
transpose = List.Transpose(lists=toNumber)

# group: Создание «спиралевидной» геометрии на основе точек, извлеченных из файла CSV
# note: Координата X
firstItem = List.FirstItem(list=transpose)
code_block = CodeBlock { 1; }
# note: Координата Y
getItemAtIndex = List.GetItemAtIndex(list=transpose, index=code_block)
# note: Координата Z
lastItem = List.LastItem(list=transpose)
byCoordinates = Point.ByCoordinates(x=firstItem, y=getItemAtIndex, z=lastItem)

# group: Масштабирование
number_slider = DoubleSlider(2.337, range=0..20 step 0.1)
# note: Настройка общей расстановки
# координат
scale = Geometry.Scale(geometry=byCoordinates, amount=number_slider, lacing=Longest)
