# Dynamo graph ImportExport_Excel to Dynamo.dyn (Dynamo 3.1.0.3411)
# author: Dynamo Team
# Пример графика, демонстрирующий импорт данных из Excel в Dynamo.

# group: Исходные входные данные
# note: Перейдите к файлу Excel (XLSX), из которого требуется загрузить данные.
file_path = Filename("..\..\Data\helix.xlsx")
# note: Получение файла на основе указанного пути к нему.
fromPath = FileObject(path=file_path)  # "File.FromPath"
# note: Имя листа Excel, содержащего данные, которые требуется импортировать.
string = StringInput("helix")

# group: Импорт данных Excel
# note: Этот узел может считывать данные из листа Excel. Данные считываются из всех столбцов и строк, в результате чего получается двойной массив [][] (матрица).
importExcel = Data.ImportExcel(file=fromPath, sheetName=string)

# group: Перестановка
# note: Отражение (перестановка) списка (матрицы). Столбцы становятся строками, а строки — столбцами.
transpose = List.Transpose(lists=importExcel)

# group: Извлечение координат точек
number = DoubleInput(0)
# note: Координата X
getItemAtIndex = List.GetItemAtIndex(list=transpose, index=number)
number_2 = DoubleInput(1)
# note: Координата Y
getItemAtIndex_2 = List.GetItemAtIndex(list=transpose, index=number_2)
number_3 = DoubleInput(2)
# note: Координата Z
getItemAtIndex_3 = List.GetItemAtIndex(list=transpose, index=number_3)

# group: Создание спирали на основе извлеченных из Excel данных
byCoordinates = Point.ByCoordinates(x=getItemAtIndex, y=getItemAtIndex_2, z=getItemAtIndex_3, lacing=Longest)
