# Dynamo graph OpenXMLExport_Data To Excel.dyn "OpenXMLЭкспорт_данных в Excel" (Dynamo 3.0.3.7594)
# author: Dynamo Team
# Пример графика Dynamo, демонстрирующий экспорт данных в Excel.

# group: Исходные входные данные
# note: Определение количества точек. Представляет собой «высоту» спирали.
number_slider = DoubleSlider(1.7, range=0..5 step 0.1)

# group: Создание спирали
# note: Создание последовательности чисел, начиная с 0. Приращение равно 10. Количество точек умножается на 360, поэтому, если входное значение numCircles равно 1, получится 37 чисел (от 0 до 360) и спираль будет полностью повернута.
code_block = CodeBlock(numCircles=number_slider) { 0..(360*numCircles)..10; }
# note: функция косинуса
cos = Math.Cos(angle=code_block, lacing=Longest)
# note: функция синуса
sin = Math.Sin(angle=code_block, lacing=Longest)
# note: разделить на 100
code_block_2 = CodeBlock(x=code_block) { x/100; }
# note: Создание списка точек. Компонентом X является косинус, Y — синус, а Z — исходное значение, поделенное на 100.
byCoordinates = Point.ByCoordinates(x=cos, y=sin, z=code_block_2, lacing=Longest)
# note: Создание структуры списка из списка точек. В результате получается список, содержащий три списка ([][] — двойной массив), каждый из которых содержит координаты точек X, Y и Z соответственно.
code_block_3 = CodeBlock(pt=byCoordinates) { [pt.X,pt.Y,pt.Z]; }

# group: Создание входных данных для экспорта
# 1. Путь к файлу CSV.
# 2. Имя листа.
# 3. Преобразованный список точек.
# 4. Начальный индекс для строки и столбца в Excel.
# note: Путь к файлу XLSX.
file_path = Filename("..\..\Data\icosohedron_points.xlsx")
# note: Имя листа в Excel.
string = StringInput("helix")
# note: Отражение матрицы (перестановка списка). Столбцы становятся строками, а строки — столбцами.
transpose = List.Transpose(lists=code_block_3)
# note: Количество столбцов/строк, с которых начинается запись данных в Excel
number = DoubleInput(0)

# group: Экспорт данных в файл Excel
# note: Экспорт данных в Excel
openXMLExportExcel = Data.OpenXMLExportExcel(filePath=file_path, sheetName=string, data=transpose, startRow=number, startColumn=number)
