# Dynamo graph OpenXMLImport_Data From Excel.dyn "OpenXMLИмпорт_данных из Excel" (Dynamo 3.1.0.3411)
# author: Dynamo Team
# Пример графика, демонстрирующий импорт данных из файла Excel.

# group: Исходные входные данные
# 1. Путь к файлу Excel.
# 2. Имя листа.
file_path = Filename("..\..\Data\helix.xlsx")
string = StringInput("helix")

# group: Извлечение данных из Excel
# note: Чтение данных из Excel
openXMLImportExcel = Data.OpenXMLImportExcel(filePath=file_path, sheetName=string)

# group: Разбор данных из Excel
# Разбор данных представляет собой обработку источника данных таким образом, чтобы он стал нативным для среды перед его использованием.
# note: Перестановка списка (отражение матрицы). Столбцы становятся строками, а строки — столбцами.
transpose = List.Transpose(lists=openXMLImportExcel)
# note: первый список
number = DoubleInput(0)
# note: второй список
number_2 = DoubleInput(1)
# note: третий список
number_3 = DoubleInput(2)

# group: Создание спирали
# note: Координата X
getItemAtIndex = List.GetItemAtIndex(list=transpose, index=number)
# note: Координата Y
getItemAtIndex_2 = List.GetItemAtIndex(list=transpose, index=number_2)
# note: Координата Z
getItemAtIndex_3 = List.GetItemAtIndex(list=transpose, index=number_3)
byCoordinates = Point.ByCoordinates(x=getItemAtIndex, y=getItemAtIndex_2, z=getItemAtIndex_3, lacing=Longest)
