# Dynamo graph Basics_Basic01.dyn (Dynamo 2.19.3.6543)
# author: Dynamo Team
# 连接节点以添加两个数字

# note: 基本函数输入(如数字和字符串)均可通过浏览或搜索从画布左侧的库中进行选择。
# 要对数据执行的运算，如数学或几何变换，也可以从库中找到
# note: Dynamo 是可视化编程语言，其工作方式类似于其他语言，通过将简单元素连接在一起以形成更复杂的创意
# note: 从“Number”节点上的“>”端口拉出连接件，并将其连接到 + 节点上的“y”端口，然后按下应用程序左下角的“运行”按钮。
number = DoubleInput(2)  # graph input
add = number + _  # unwired: y
# note: 通过单击应用程序右下角的“运行”按钮，可以将数据可视化。如果启用“自动”运行模式，则应用程序将不断更新。
# 通过使用“Watch”节点或单击大多数节点底部的小方块，可以查看数据。
watch = Watch(add)
# note: 在“帮助”菜单中可以查看更多示例文件，或单击选项卡上的“X”关闭该文件以返回欢迎页面
number_2 = DoubleInput(6)  # graph input
