# Dynamo graph Basics_Basic02.dyn (Dynamo 2.19.3.6543)
# author: Dynamo Team
# 通过连接两点创建一条直线

# note: 在 Dynamo 环境中操纵点的位置 : 选择“Point.ByCoordinates”节点并切换到背景预览，以沿其三个轴拉动点。
byCoordinates = Point.ByCoordinates()
# note: 可将几何数据可视化为文字信息或三维空间
watch = Watch(byCoordinates)
number = DoubleInput(2)  # graph input
# note: 使用“Number Slider”和“Integer Slider”节点动态输入指定范围内的值。单击蓝色下拉箭头打开数值范围设置
number_slider = DoubleSlider(4.43, range=0..10 step 0.1)  # graph input
# note: 可以使用屏幕右上角的按钮(Ctrl + B 快捷键)在“三维背景”导航和“图形视图”导航之间切换。对于 Dynamo 和 Revit，还可以在“视图”菜单中打开/关闭“背景预览”。
byCoordinates_2 = Point.ByCoordinates(x=number, z=number_slider)
byStartPointEndPoint = Line.ByStartPointEndPoint(startPoint=byCoordinates_2, endPoint=byCoordinates)
# note: 使用“Watch 3D”节点在隔离环境中可视化三维图元
watch_3d = Watch3D(byStartPointEndPoint)
