# Dynamo graph Basics_Basic03.dyn (Dynamo 2.19.3.6543)
# author: Dynamo Team
# 创建一个简单列表

# group: 输入
# note: 可以使用序列和范围来生成数据列表。出于特定目的，可以使用许多其他节点来重新组织这些列表
number = DoubleInput(0)  # graph input
number_2 = DoubleInput(9)  # graph input
number_3 = DoubleInput(1)  # graph input

# note: 从“Start”开始到“End”，以给定的“Step”创建一系列数字
range = Range(start=number, end=number_2, step=number_3, lacing=Longest)
watch = Watch(range)
number_4 = DoubleInput(3)  # graph input
# note: 将列表切成 3 段
chop = List.Chop(list=range, lengths=number_4)
# note: 借助“Watch”节点预览结果并观察列表结构
watch_2 = Watch(chop)
# note: 获取列表中的最后一项
lastItem = List.LastItem(list=range)
watch_3 = Watch(lastItem)
