# Dynamo graph Core_AttractorPoint.dyn (Dynamo 3.0.0.6964)
# author: Dynamo Team
# 此图形创建圆柱体栅格，其中大小由吸引器点的位置确定。

# group: 信息
# note: 吸引器点
# 吸引器点是影响系统中其他图元的特征的参照点(或图元)。吸引器点通常像一块磁铁 - 图元离吸引器越近 - 它就越受吸引器影响。
# 在本例中，圆柱体的高度和直径由每个圆柱体与绕其移动的吸引器点之间的距离确定。吸引器点周围的圆柱体小于更远的圆柱体。
# 要可视化此行为，请移动吸引器点输入的两个数字滑块。
# 吸引器点是一种在设计过程中引入一定程度的响应性和动态行为的方式。

# group: 点栅格大小
# note: 使用“Code Block”创建一系列数字。在本例中，将创建一个数字介于 1 到 50 (其中 n 个步长，每个步长为 5)的序列。
数字范围 = CodeBlock { 1..50..5; }

# group: 创建点栅格
# note: 点栅格。
# 要生成点栅格。请将一系列数字传递到 X 和 Y 坐标这两个端口。在该节点上单击鼠标右键，然后将“连缀”更改为“叉积”
# note: 节点的叉积连缀将一个列表中的每一项与其他每个列表中的每一项组合在一起，从而生成类似栅格的列表结构。
# 当与“Point.ByCoordinates”节点的 X 和 Y 输入结合使用时，结果是一个平面的点栅格。如果使用第三个 Z 坐标，则结果是一个立方体形状的点栅格。
byCoordinates = Point.ByCoordinates(x=数字范围, y=数字范围, lacing=CrossProduct)

# group: 展平列表结构
# 对点执行进一步操作不需要复杂的列表结构。Flatten 仅生成一个列表。
# note: 由于不需要行和列的层次结构，因此展平列表。将此节点的输入与输出比较 - N 个列表的结构变成了一个列表。
flatten = List.Flatten(list=byCoordinates)

# group: 吸引器点位置
number_slider = DoubleSlider(24.6, range=-10..60 step 0.1)  # graph input
number_slider_2 = DoubleSlider(11.50111001, range=-10..60 step 0.1)  # graph input
# note: 吸引器点。移动输入滑块以调整该点的位置。
byCoordinates_2 = Point.ByCoordinates(x=number_slider, y=number_slider_2)

# group: 到吸引器的距离
# note: 查找吸引器点与圆柱体的每个基点之间的距离
distanceTo = Geometry.DistanceTo(geometry=flatten, other=byCoordinates_2)

# group: 生成半径和高度
# note: 使圆柱体的高度能够对吸引器点的位置作出反应的公式。在本例中，每个圆柱体的高度是到吸引器点距离的一半。请尝试使用其他公式。
圆柱体高度 = CodeBlock(x=distanceTo) { x/2; }
# note: 公式返回一个值，以用作圆柱体的半径。距离越远 - 每个圆柱体的半径越大。请尝试使用其他公式。
圆柱体半径 = CodeBlock(x=distanceTo) { x/15; }

# group: 终点
# 按给定高度(由公式定义)平移每个圆柱体的起点(原始)
# note: 要将基点(原始)上移给定值的向量
byCoordinates_3 = Vector.ByCoordinates(z=圆柱体高度)
# note: 将此新的 Z 值(高度)添加到原始栅格点，以获取圆柱体的顶点。
add = Point.Add(point=flatten, vectorToAdd=byCoordinates_3)

# group: 创建圆柱体
# note: 使用创建圆柱体(通过给定的起点和终点以及给定半径)的方法
byPointsRadius = Cylinder.ByPointsRadius(startPoint=flatten, endPoint=add, radius=圆柱体半径)
