# Dynamo graph Core_CodeBlocks.dyn (Dynamo 3.4.1.7055)
# author: Dynamo Team
# 此图形探索代码块的各种用途和应用

# group: 信息
# note: 代码块
# 代码块可以通过在画布中双击来创建。代码块也可以在节点库中的“Script”>“Editor”类别下找到。
# 代码块可以包含:
# •  数值(整数和浮点数)
# •  字符串(文字)
# •  布尔值(True 或 False)
# •  列表 [0,1,2]
# •  表达式(a+3)
# •  变量
# 其他节点可以转换为代码块表达式: 选择一个或多个节点，然后在节点之间的空间中单击鼠标右键以选择“节点至代码”。没有与此操作等效的反向操作 - 代码块无法自动转换为节点。

# group: 节点即代码块
# note: 代码块可用于调用库中的任何其他节点。库中的节点通常有三种类型:
#     创建:		创建内容
#     操作:		对内容执行操作
#     查询:		获取已存在内容的特性
# 在代码块中调用这三种类型的方法或节点时，它们的处理方式有所不同。

# group: 几何图形创建
# note: 同时，这些语句形成在基准点创建螺旋曲线的算法。
code_block = CodeBlock()
# ---------- code_block.designscript (16 lines) ----------
// Basic inputs
base = Point.ByCoordinates(3,3);
coils = 3;
height = 5;
rad = 0.5;

// Make a series of points
numPts = 8*coils + 1;
seq = 0..(coils*360)..#numPts;
x = rad * Math.Cos(seq);
y = rad * Math.Sin(seq);
z = 0..height..#numPts;
pts = Point.ByCoordinates(x + base.X, y + base.Y, z + base.Z);

// Pass a curve through those points
NurbsCurve.ByPoints(pts);
# ----------------------------------------
# note: 通过给定名称、指定输入和指示返回结果，将螺旋算法转换为一个函数。
code_block_2 = CodeBlock()
# ---------- code_block_2.designscript (13 lines) ----------
def MakeSpring(base,coils,height,rad)
{
// Make a series of points
numPts = 8*coils + 1;
seq = 0..(coils*360)..#numPts;
x = rad * Math.Cos(seq);
y = rad * Math.Sin(seq);
z = 0..height..#numPts;
pts = Point.ByCoordinates(x + base.X, y + base.Y, z + base.Z);

// Return the curve that passes through those points
return = NurbsCurve.ByPoints(pts);
};
# ----------------------------------------
code_block_3 = CodeBlock { 0..6..2; }
code_block_4 = CodeBlock { 10..20..2; }
# note: 对螺旋算法进行转换，以定义具有任意名称的函数“MakeSpring”。调用该函数可生成多个弹簧，这些弹簧具有随机高度，并以网格的形式布置。
# note: 生成网格
byCoordinates = Point.ByCoordinates(x=code_block_3, y=code_block_4, lacing=CrossProduct)
flatten = List.Flatten(list=byCoordinates)
code_block_5 = CodeBlock { 5; }
count = List.Count(list=flatten)
# note: 生成一系列随机数字(以 5 为比例)用作弹簧高度
randomList = Math.RandomList(amount=count)
code_block_6 = CodeBlock(random=randomList) { random * 5; }
# note: 内容列表或单值项可用于函数调用的输入。数据可通过端口传入到或直接声明，例如所有弹簧的半径为“0.5”。
code_block_7 = CodeBlock(basePoints=flatten, numCoils=code_block_5, height=code_block_6) { MakeSpring(basePoints,numCoils,height,0.5); }

# group: 函数
# note: 函数可在“代码块”节点中直接定义，并可在该定义的任意位置调用。
# 第一行包含关键字“默认”，接着是函数名，然后是括号中的输入。
# 大括号定义函数的主体。每行都必须以分号结尾。
# 返回值具有“Return = ”。
code_block_8 = CodeBlock()
# ---------- code_block_8.designscript (11 lines) ----------
/* This is a multi-line comment,
     which continues for mulitple
     lines. */

def FunctionName(input1, input2)
{
// This is a comment
sum = input1 + input2;

return = sum;
};
# ----------------------------------------
code_block_9 = CodeBlock { 1; }
# note: 定义函数的代码块节点没有输入或输出端口，因为它们是从其他代码块节点调用的。
code_block_10 = CodeBlock { 2; }
# note: 通过提供相同名称和相同数量的参数，调用同一文件中具有另一代码块节点的函数。
code_block_11 = CodeBlock(in1=code_block_9, in2=code_block_10) { FunctionName(in1,in2); }
watch = Watch(code_block_11)
code_block_12 = CodeBlock { "cat"; }
code_block_13 = CodeBlock { "dog"; }
# note: 函数定义中未指定输入参数的类型，因此将运算接收到的所有数据。
code_block_14 = CodeBlock(in1=code_block_12, in2=code_block_13) { FunctionName(in1,in2); }
watch_2 = Watch(code_block_14)
origin = Point.Origin()
code_block_15 = CodeBlock { 16; }
# note: 对于对函数没有意义的输入，函数调用所产生的结果为空。
code_block_16 = CodeBlock(in1=origin, in2=code_block_15) { FunctionName(in1,in2); }
watch_3 = Watch(code_block_16)

# group: 数值
# 将专门构建节点与代码块进行比较
# note: 专门构建
number = DoubleInput(3.14)
结果 = Watch(number)
# note: 代码块
code_block_17 = CodeBlock { 3.140; }
watch_4 = Watch(code_block_17)

# group: 字符串值
# 将专门构建节点与代码块进行比较
# note: 专门构建
string = StringInput("Less is more.")
结果_2 = Watch(string)
# note: 使用引号 "" 生成包含 Code Block 节点的字符串
code_block_18 = CodeBlock { "Less is more."; }
watch_5 = Watch(code_block_18)
# note: 使用此节点查看输出值类型
type = Object.Type(object=code_block_18)
watch_6 = Watch(type)

# group: 表达式
# 使用专门构建的 * 节点和代码块执行乘法运算
number_2 = DoubleInput(3)
number_3 = DoubleInput(5)
# note: 使用 * 节点乘以两个数字
mul = number_2 * number_3
结果_3 = Watch(mul)
# note: 使用代码块执行乘法
code_block_19 = CodeBlock { 3*5; }
watch_7 = Watch(code_block_19)
code_block_20 = CodeBlock { 3; }
code_block_21 = CodeBlock { 5; }
# note: 使用变量作为乘法运算的输入。
code_block_22 = CodeBlock(a=code_block_20, b=code_block_21) { a*b; }
watch_8 = Watch(code_block_22)

# group: 查询
# 查询并返回对象特性的方法
# note: 通过代码块，用户可以灵活地决定如何指定输入内容。以下是几种不同的方法，例如，用于生成相同的点。
code_block_23 = CodeBlock { 10; }
code_block_24 = CodeBlock { -10; }
# note: 使用 Point.ByCoordinates 节点的现成方法
byCoordinates_2 = Point.ByCoordinates(x=code_block_23, y=code_block_24)
watch_9 = Watch(byCoordinates_2)
# note: 代码块使用“Point.ByCoordinates”方法以及 X、Y 和 Z 三个变量，其中 Z 在同一代码块中定义并用分号“;”分隔
code_block_25 = CodeBlock(x=code_block_23, y=code_block_24) { z = 0; Point.ByCoordinates(x,y,z); }
watch_10 = Watch(code_block_25.out1)
code_block_26 = CodeBlock { Point.ByCoordinates(10,0,0); }
# note: 等效于相同方法的代码块。查询方法不需要括号
code_block_27 = CodeBlock(pt=code_block_26) { pt.X; }
watch_11 = Watch(code_block_27)
# note: 返回点的 X 坐标的现成查询方法
X = Point.X(point=code_block_26)
watch_12 = Watch(X)
# note: 此处使用相同数值的负值的公式已集成到输入变量的表示法中
code_block_28 = CodeBlock(num=code_block_23) { Point.ByCoordinates(num,-num,0); }
watch_13 = Watch(code_block_28)
# note: 代码块使用 Point.ByCoordinates 方法，所有三个变量都作为输入提供
code_block_29 = CodeBlock { Point.ByCoordinates(10,-10,0); }
watch_14 = Watch(code_block_29)

# group: 创建
# 创建几何图形、列表、Revit 图元或其他对象的方法
# note: 在原点处创建点的现成方法
origin_2 = Point.Origin()
watch_15 = Watch(origin_2)
# note: 尽管此方法无需输入内容，但括号必不可少
code_block_30 = CodeBlock { Point.Origin(); }
watch_16 = Watch(code_block_30)
code_block_31 = CodeBlock { 0; -10; }
# note: 通过提供 X 和 Y 坐标创建点的现成方法
byCoordinates_3 = Point.ByCoordinates(x=code_block_31.out0, y=code_block_31.out1)
watch_17 = Watch(byCoordinates_3)
# note: 使用代码块复制“Point.ByCoordinates”节点行为。如果您将鼠标光标悬停在原始现成节点上，将找到方法名称: 工具提示窗口底部会提到该方法。
# 必须按现成节点中找到的顺序指定输入。
code_block_32 = CodeBlock { Point.ByCoordinates(0,-10); }
watch_18 = Watch(code_block_32)

# group: 操作
# 针对对象执行操作的方法
origin_3 = Point.Origin()
ZAxis = Vector.ZAxis()
# note: 将向量添加到点的现成方法
add = Point.Add(point=origin_3, vectorToAdd=ZAxis)
watch_19 = Watch(add)
origin_4 = Point.Origin()
ZAxis_2 = Vector.ZAxis()
# note: 操作方法是针对对象执行的。在对象本身后使用点表示法，并指定方法和在现成节点上找到的第一个输入之外的所有输入(因为第一个输入端口是对象本身，您已有该输入端口！)。
code_block_33 = CodeBlock(pt=origin_4, vector=ZAxis_2) { pt.Add(vector); }
watch_20 = Watch(code_block_33)

# group: 创建列表
# note: 使用方括号定义列表并使用逗号分隔各个元素来创建列表
code_block_34 = CodeBlock { ["San Francisco","New York","Chicago"]; }
watch_21 = Watch(code_block_34)
# note: 使用以下表示法从列表中获取项目: list [ i ]，其中 i 是项目的索引。此方法等同于使用 GetItemAtIndex 节点
code_block_35 = CodeBlock(cities=watch_21) { cities[2]; }
watch_22 = Watch(code_block_35)
# note: Multiple variables are defined in this code block, and at the end, a list is created containing all of them.
code_block_36 = CodeBlock()
# ---------- code_block_36.designscript (7 lines) ----------
str0 = "alpha";
str1 = "beta";
str2 = "charlie";
str3 = "delta";
str4 = "echo";
//
[str0,str1,str2,str3,str4];
# ----------------------------------------
watch_23 = Watch(code_block_36.out5)
code_block_37 = CodeBlock(phonetic=watch_23) { phonetic[2..3]; }
watch_24 = Watch(code_block_37)
code_block_38 = CodeBlock { 2; }
getItemAtIndex = List.GetItemAtIndex(list=watch_21, index=code_block_38)
watch_25 = Watch(getItemAtIndex)

# group: 合并列表和访问列表项
# 说明 <双击此处编辑组说明>
# note: 创建嵌套列表并从嵌套列表获取项。
code_block_39 = CodeBlock()
# ---------- code_block_39.designscript (6 lines) ----------
kitchen = ["table","stove","sink","refrigerator"];
livingRoom = ["sofa","books"];
bedroom = ["bed","dirty clothes"];
bathroom = ["tooth brush"];
//
allMyStuff = [kitchen, livingRoom, bedroom, bathroom];
# ----------------------------------------
watch_26 = Watch(code_block_39.allMyStuff)
# note: 访问第三个列表中的第二项(或者，换句话说，访问索引为“2”的列表中索引为“1”的项)
code_block_40 = CodeBlock(list=watch_26) { list[2][1]; }
watch_27 = Watch(code_block_40)

# group: 复制
# note: 复制导向可用于指定将列表连缀为“叉积”
code_block_41 = CodeBlock { x_vals = 0..10; y_vals = -30..-40; }
code_block_42 = CodeBlock(x_vals=code_block_41.x_vals, y_vals=code_block_41.y_vals) { Point.ByCoordinates(x_vals, y_vals); }
code_block_43 = CodeBlock { x_vals = 0..10; y_vals = -15..-25; }
code_block_44 = CodeBlock(x_vals=code_block_43.x_vals, y_vals=code_block_43.y_vals) { Point.ByCoordinates(x_vals<1>, y_vals<2>); }
byCoordinates_4 = Point.ByCoordinates(x=code_block_41.x_vals, y=code_block_41.y_vals)
byCoordinates_5 = Point.ByCoordinates(x=code_block_43.x_vals, y=code_block_43.y_vals, lacing=CrossProduct)
# note: 复制导向使用尖括号，获取两到三个一维集合，然后将
# 图元搭配在一起以生成一维、两维或三维集合。
# note: 在本示例中，有 2 个 X 值和 5 个 Y 值。复制导向可以指定，生成的组合为 5 个点的 2 个列表或 2 个点的 5 个列表。
code_block_45 = CodeBlock()
# ---------- code_block_45.designscript (5 lines) ----------
x_vals = 0..1;
y_vals = -3..-7;
//
Point.ByCoordinates(x_vals<1>, y_vals<2>);
Point.ByCoordinates(x_vals<2>, y_vals<1>);
# ----------------------------------------
watch_28 = Watch(code_block_45.out2)
watch_29 = Watch(code_block_45.out3)

# group: 布尔
# 将专门构建节点与代码块进行比较
# note: 布尔切换节点
boolean = BoolSelector(true)
watch_30 = Watch(boolean)
# note: 在代码块中使用“true”或“false”值可获得相同结果
code_block_46 = CodeBlock { true; }
watch_31 = Watch(code_block_46)
