# Dynamo graph Core_ListAtLevel.dyn (Dynamo 3.1.0.3411)
# author: Dynamo Team
# 我们探索 List@Level 以及如何使用它来实现与 List.Map 节点相同的结果。我们创建一系列面板来演示 List@Level 实际上如何工作。

# group: 信息
# note: 要确定要使用列表的哪个级别，请查看预览气泡的底部或观察节点并跟随 List@Level 注释中的线。

# group: 信息
# 使用 List@Level 的一般信息
# note: LIST@LEVEL
# List@Level 替代了 List.Map 的功能，使您可以直接选择要使用的列表的级别。
# note: 要更改正在使用的列表级别，请单击列表输入端口旁边的箭头，然后启用“使用级别”选项。
# 当在输入端口上首次启用 List@Level 时，将选择第二个最内侧级别(L2)处的列表以进行处理。

# group: 信息
# 此图形的工作方式
# note: 我们要在网格的内部创建面板。为此，我们将需要获取最内侧级别中每个列表的索引 1 和 2 处的点。这可以通过使用 List@Level 功能轻松完成。通过启用 “保持列表结构”可保持列表的分组。但是，首先让我们仔细地检查使用 Point.ByCoordinates 创建的列表，以确定要使用列表的哪个级别。

# group: 输入
# 说明 <双击此处编辑组说明>
code_block = CodeBlock { 0..30..#8; 12..0..#4; }
# note: 在此示例中，我们创建一个包含一系列点的三维列表。L3 处有 8 个列表，每个列表包含另外 4 个列表(L2)。4 个列表中的每一个都包含 4 个点(L1)，共计 128 个点。
byCoordinates = Point.ByCoordinates(x=code_block.out0, y=code_block.out1, z=code_block.out1, lacing=CrossProduct)

# group: 将 List.Map 替换为 List@Level
code_block_2 = CodeBlock { [1,2]; }
# note: 在早期版本的 Dynamo 中，List.Map 用于获取列表的内部级别。虽然使用 List.Map 可以实现相同的结果，但它会将更多节点引入到工作空间中。此处我们使用 List@Level 以更高效的方式抓取网格的内部点。我们将使用这些点创建面板。
# 我们还使用 “保持列表结构” 选项来保持初始列表的分组并防止展平。如果 “保持列表结构” 处于禁用状态，则将创建单个 NurbsSurface，而不是八个。
getItemAtIndex = List.GetItemAtIndex(list=byCoordinates@@L2, index=code_block_2)
code_block_3 = CodeBlock { [1,2]; }
# note: 列表位于不同的级别上，L1 为最低级别。由此节点生成的图元的总数是 64，如右下角所示。
getItemAtIndex_2 = List.GetItemAtIndex(index=code_block_3)  # unwired: list
# note: 下面是相当于应用 List@Level 的 List.Map(需要额外节点)
map = List.Map(f_x=getItemAtIndex_2)  # unwired: list
map_2 = List.Map(list=byCoordinates, f_x=map)

# group: 创建几何图形
# note: 选择点集后，我们现在可以创建面板。
byPoints = NurbsSurface.ByPoints(points=getItemAtIndex)
byBestFitThroughPoints = Line.ByBestFitThroughPoints(bestFitPoints=getItemAtIndex)

# group: 使用 List@Level 和 Count 检查列表
# note: List.Count 节点返回显示在每个列表中的图元的数量。根据选定的级别，返回不同的值。尝试通过单击 L3 旁边的箭头来改变它的值。
# note: L3 处有 8 个列表，每个均包含四个列表。因此，选择 L3 将在八个列表上执行 List.Count 函数，给出 8 个“4”值。
count = List.Count(list=byCoordinates@L3)

# group: 使用“保持列表结构”
# note: 此节点返回显示在 L2 的每个列表中的图元的数量。默认情况下，结果将展平为一维列表。
count_2 = List.Count(list=byCoordinates@L2)
# note: 要保留列表的嵌套结构，请选择选项“保持列表结构”。“@@”指示如何在 DesignScript 中保持列表结构。
count_3 = List.Count(list=byCoordinates@@L2)

# group: 使用 List@Level 和 Flatten 检查列表
# note: 作为另一个示例，您可以通过将 List@Level 功能与“Flatten”节点一起使用来轻松展平列表内部级别处的嵌套结构。尝试通过单击 List@Level 微调器中级别旁边的箭头来更改要展平的级别。
# note: 选择 L3 会将该级别处的八个列表转换为一维阵列。因为八个列表中的每一个均包含四个项目(也是列表)，这将展平 L3 处的所有列表，产生包含 16 个点的八个列表。
flatten = List.Flatten(list=byCoordinates@L3)
