# Dynamo graph Core_ListLacing.dyn (Dynamo 3.1.0.3411)
# author: Dynamo Team
# 列表连缀 - 在此图形中探索和演示列表连缀的所有模式

# group: 信息
# note: 列表连缀
# 连缀是 Dynamo 节点用于将不同列表的项匹配在一起的逻辑。Dynamo 中的大多数节点允许您通过设置“连缀行为”选择合并列表信息的方式。
# 在这些示例中，都有两个点列表被传递到 Line.ByStartPointEndPoint 节点。节点使得直线必须确定要绘制多少直线以及在哪些点集之间绘制。
# 通过右键单击具有两个或更多输入端口的节点并选择“连缀”，可设置连缀行为。

# group: 提示
# note: 提示: 对于生成几何图形的任何节点，可在背景预览中将项索引显示为标签。单击鼠标右键，然后选择“显示标签”。

# group: 提示
# note: 提示: 通过右下角的小图示符在节点上标识节点的连缀行为。如果看不到任何图示符，则节点不会连缀。

# group: 输入
# note: 较长系列 (10 个元素)
code_block = CodeBlock { 0..9; }
code_block_2 = CodeBlock { 4; }
# note: 较短系列 (6 个元素)
code_block_3 = CodeBlock { 0..5; }
code_block_4 = CodeBlock { 0..9; }
code_block_5 = CodeBlock { -10; 4; }
code_block_6 = CodeBlock { 0..5; }
code_block_7 = CodeBlock { 0..9; }
code_block_8 = CodeBlock { 10; 4; }
code_block_9 = CodeBlock { 0..5; }

# group: 创建点
# 创建 2 组点(10 x 6)，以用作 Line.ByStartPointEndPoint 的输入
byCoordinates = Point.ByCoordinates(x=code_block, z=code_block_2)
byCoordinates_2 = Point.ByCoordinates(x=code_block_3)

# group: 最长连缀
# note: 最长连缀
# 绘制的直线与输入点较长列表中的项数一样多。当节点用完较短列表中的点后，它将根据需要生成最后一项的多个副本，以与最长列表中的终点项匹配。
byStartPointEndPoint = Line.ByStartPointEndPoint(startPoint=byCoordinates, endPoint=byCoordinates_2, lacing=Longest)

# group: 创建点
# 创建 2 组点(10 x 6)，以用作 Line.ByStartPointEndPoint 的输入
byCoordinates_3 = Point.ByCoordinates(x=code_block_4, y=code_block_5.out0, z=code_block_5.out1)
byCoordinates_4 = Point.ByCoordinates(x=code_block_6, y=code_block_5.out0)

# group: 最短连缀
# note: 最短连缀
# 仅绘制与最短输入列表中项数一样多的直线。较长列表中的“剩余”点均被忽略。
byStartPointEndPoint_2 = Line.ByStartPointEndPoint(startPoint=byCoordinates_3, endPoint=byCoordinates_4)

# group: 创建点
# 创建 2 组点(10 x 6)，以用作 Line.ByStartPointEndPoint 的输入
byCoordinates_5 = Point.ByCoordinates(x=code_block_7, y=code_block_8.out0, z=code_block_8.out1)
byCoordinates_6 = Point.ByCoordinates(x=code_block_9, y=code_block_8.out0)

# group: 叉积连缀
# note: 叉积连缀
# 对所有可能的组合进行配对。对于较长列表中的 10 个点和较短列表中的 6 个点，结果将有 10 x 6 = 60 条直线。
byStartPointEndPoint_3 = Line.ByStartPointEndPoint(startPoint=byCoordinates_5, endPoint=byCoordinates_6, lacing=CrossProduct)
# note: 生成的直线将存储在嵌套列表中，10 条直线的 6 个列表或 6 条直线的 10 个列表，具体取决于最先指定的列表。
watch = Watch(byStartPointEndPoint_3)
