# Dynamo graph Core_Math.dyn (Dynamo 3.4.1.7055)
# author: Dynamo Team
# 这是对 Dynamo 的各种数学函数和功能的广泛探索

# group: 信息
# note: 数学
# Dynamo 中的数学运算可使用数学库和运算符库中的节点来完成，也可以使用 Code Block 来完成。在下面，请参见如何使用以下三种方法之一执行几个基本数学运算。

# group: 基本算术运算符
# note: 算术运算符，例如
# +、-、*、/、%

# group: 基本逻辑运算符
# note: 比较运算符，例如
# <、>、<=、>=、!=、==

# group: 布尔运算符
# note: 布尔运算符
# (在库查找其他运算符。)

# group: 舍入
# note: 舍入

# group: 复杂数学函数
# 使用节点、Python、Fo 实现相同最终结果的 4 个示例
# note: This example shows four different ways to approach dealing with Math functions.  Each of these examples starts with a grid of points, calculates z-coordinates for the points and then makes a surface.  Only the calculation method differs; these methods all solve the same.
# 1. Nodes. Math nodes are in the Math section of the Library which is further split into Functions, Logic and Operators.
# 2. Python.
# 3. Code Block Node.  Double-click anywhere in the canvas to create a code block node.  Syntax for each function matches the name of the node in Dynamo.
# ** Note: You can adjust the resolution of the geometry preview by navigating to the Render Precision settings: Dynamo -> Preferences -> Visual Settings -> Render Precision
# note: 有关更多示例请参见:
# http://dynamobim.org/math-transit/

# group: 圆弧
# note: 使用 2 种不同的方法创建圆弧，一种方法是使用节点，另一种方法是使用代码块。为了清晰起见，将可视化结果

# group: 提示
# 亮显几何图形节点
# note: 提示: 选择绘制几何图形的节点会使其创建的几何图形变为蓝色。该代码块绘制图形的轴、沿曲线的点、以及曲线本身。选择代码块，以查看在背景中绘制的是哪条曲线。

# group: 余弦曲线
# note: 此组示例演示了如何使用节点和代码块来绘制余弦函数图形。
# 每个示例均采用一系列数字作为一系列点的 X 值、根据 X 值计算 Y 值，然后绘制一条余弦曲线形状的线。每个图形终点处的较大代码块会将绘制的几何图形移至屏幕的不同部分，以防止它们全部彼此重叠。

# group: 提示
# 渲染精度
# note: Tip: Adjust how precisely the geometry in the background preview is rendered by navigating to Dynamo -> Preferences -> Visual Settings -> Render Precision.  A higher value will make curved surfaces look smoother, but it will take more processing power to draw.

# group: 节点 > 点列表的初始输入
code_block = CodeBlock { -10..10..#20; }

# group: 节点 > 初始点列表创建和操作
# note: 生成点的网格。
# 注意连缀行为是
# “叉积”
byCoordinates = Point.ByCoordinates(x=code_block, y=code_block, lacing=CrossProduct)
flatten = List.Flatten(list=byCoordinates)
X = Point.X(point=flatten)
Y = Point.Y(point=flatten)

# group: 节点 > 振幅
# note: 振幅
number_slider = DoubleSlider(5.51, range=0..10 step 0.1)  # graph input

# group: 节点 > 正方形
number = DoubleInput(2)  # graph input
pow = Math.Pow(number=X, power=number)

# group: 节点 > 正方形
number_2 = DoubleInput(2)  # graph input
pow_2 = Math.Pow(number=Y, power=number_2)

# group: 节点 > 频率
# note: 频率
number_slider_2 = DoubleSlider(1.724, range=0..6 step 0.1)  # graph input

# group: 节点 > 正方形
number_3 = DoubleInput(2)  # graph input
pow_3 = Math.Pow(number=number_slider_2, power=number_3)

# group: 节点 > 一系列数学计算和操作，用于使用节点创建“涟漪”几何图形
add = pow + pow_2
add_2 = add + pow_3
sqrt = Math.Sqrt(number=add_2)
# note: 在 Dynamo 中角度以度为单位
radiansToDegrees = Math.RadiansToDegrees(radians=sqrt)
sin = Math.Sin(angle=radiansToDegrees)
div = sin / sqrt
mul = number_slider * div

# group: 节点 > 收集生成的点并为最终渲染做准备
byCoordinates_2 = Point.ByCoordinates(x=X, y=Y, z=mul)
# note: 根据点的初始集合(20x20)计数点的组数
count = List.Count(list=byCoordinates)

# group: 节点 > 点集合
# note: 将平级列表按行分割为
# 列表系列
chop = List.Chop(list=byCoordinates_2, lengths=count)

# group: 节点 > 曲线网络
# note: 通过各点创建 NURBS
# 曲线
byPoints = NurbsCurve.ByPoints(points=chop)

# group: 节点 > 最终曲面
# note: 创建曲面
byLoft = Surface.ByLoft(crossSections=byPoints)

# group: 代码块 > 点列表的初始输入
code_block_2 = CodeBlock { -10..10..#20; }

# group: 代码块 > 初始点列表创建和操作
byCoordinates_3 = Point.ByCoordinates(x=code_block_2, y=code_block_2, lacing=CrossProduct)
flatten_2 = List.Flatten(list=byCoordinates_3)
Y_2 = Point.Y(point=flatten_2)
X_2 = Point.X(point=flatten_2)

# group: 代码块 > 移动几何图形的辅助函数
# note: 将几何图形移动过去
code_block_3 = CodeBlock(x=Y_2) { x+60; }

# group: 代码块 > 频率
number_slider_3 = DoubleSlider(1.724, range=0..5 step 0.1)  # graph input

# group: 代码块 > 振幅
number_slider_4 = DoubleSlider(5.51, range=0..10 step 0.1)  # graph input

# group: 代码块 > 一系列数学计算和操作，用于使用 Python 创建“涟漪”几何图形
# note: 数学方法函数的名称与第一个示例中使用的 Dynamo 节点名称匹配。
code_block_4 = CodeBlock(x=X_2, y=Y_2, c=number_slider_3, A=number_slider_4)
# ---------- code_block_4.designscript (6 lines) ----------
sum = Math.Pow(x,2) + Math.Pow(y,2) + Math.Pow(c,2);

num1 = Math.Sqrt(sum);
num2 = Math.Sin( Math.RadiansToDegrees(num1) );

A * num2 / num1;
# ----------------------------------------

# group: 代码块 > 收集生成的点并为最终渲染做准备
byCoordinates_4 = Point.ByCoordinates(x=code_block_3, y=X_2, z=code_block_4.out3)
count_2 = List.Count(list=byCoordinates_3)

# group: 代码块 > 点集合
chop_2 = List.Chop(list=byCoordinates_4, lengths=count_2)

# group: 代码块 > 曲线网络
byPoints_2 = NurbsCurve.ByPoints(points=chop_2)

# group: 代码块 > 最终曲面
byLoft_2 = Surface.ByLoft(crossSections=byPoints_2)

# group: Python > 点列表的初始输入
code_block_5 = CodeBlock { -10..10..#20; }

# group: Python > 初始点列表创建和操作
byCoordinates_5 = Point.ByCoordinates(x=code_block_5, y=code_block_5, lacing=CrossProduct)
flatten_3 = List.Flatten(list=byCoordinates_5)
X_3 = Point.X(point=flatten_3)
Y_3 = Point.Y(point=flatten_3)

# group: Python > 移动几何图形的辅助函数
# note: 将几何图形移动过去
code_block_6 = CodeBlock(x=X_3) { x+30; }

# group: Python > 振幅
number_slider_5 = DoubleSlider(5.51, range=0..10 step 0.1)  # graph input

# group: Python > 频率
number_slider_6 = DoubleSlider(1.724, range=0..5 step 0.1)  # graph input

# group: Python > 一系列数学计算和操作，用于使用 Python 创建“涟漪”几何图形
python_script = Python(Amplitude=number_slider_5, X=X_3, Y=Y_3, Frequency=number_slider_6)  # CPython3
# ---------- python_script.python (27 lines) ----------
import clr
clr.AddReference('ProtoGeometry')
from Autodesk.DesignScript.Geometry import *

import math

# The inputs to this node will be stored as a list in the IN variable.
amp = IN[0]   # single value
x = IN[1]     # list
y = IN[2]     # list (expect same length as x)
c = IN[3]     # single value

# Declare an empty array of z-values
z = []

# Solve the equation for each x and y value
for index in range(len(x)):
	sum = math.pow(x[index],2) + math.pow(y[index],2) + math.pow(c,2)
	num1 = math.sqrt(sum)
	num2 = math.sin(num1)
	zVal = amp * num2 / num1
	
	# Append the answer to the list of z values
	z.append(zVal)

# Assign the z-values to the OUT variable
OUT = z
# ----------------------------------------

# group: Python > 收集生成的点并为最终渲染做准备
byCoordinates_6 = Point.ByCoordinates(x=code_block_6, y=Y_3, z=python_script)
count_3 = List.Count(list=byCoordinates_5)

# group: Python > 点集合
chop_3 = List.Chop(list=byCoordinates_6, lengths=count_3)

# group: Python > 曲线网络
byPoints_3 = NurbsCurve.ByPoints(points=chop_3)

# group: Python > 最终曲面
byLoft_3 = Surface.ByLoft(crossSections=byPoints_3)

# group: 使用代码块创建余弦曲线 > 输入
# note: 基准坐标点
code_block_7 = CodeBlock { 25; 20; }
# note: X 值系列
code_block_8 = CodeBlock { 0..10..#20; }
# note: 振幅
number_slider_7 = DoubleSlider(3, range=0..10 step 0.1)  # graph input
# note: 频率
number_slider_8 = DoubleSlider(36, range=0..100 step 0.1)  # graph input

# group: 使用代码块创建余弦曲线 > Cos 曲线函数
# 获取给定频率和角度的余弦值并将其乘以振幅
code_block_9 = CodeBlock(amplitude=number_slider_7, frequency=number_slider_8, angle=code_block_8) { amplitude * Math.Cos(frequency * angle); }

# group: 使用代码块创建余弦曲线 > 中间操作
byCoordinates_7 = Point.ByCoordinates(x=code_block_7.out0, y=code_block_7.out1)
byCoordinates_8 = Point.ByCoordinates(x=code_block_8, y=code_block_9)

# group: 使用代码块创建余弦曲线 > 创建和可视化余弦曲线
code_block_10 = CodeBlock(base=byCoordinates_7, pts=byCoordinates_8)
# ---------- code_block_10.designscript (14 lines) ----------
// Make axes from base point
dimension = 10;
top = Point.ByCoordinates(base.X, base.Y + dimension/2);
bottom = Point.ByCoordinates(base.X, base.Y - dimension/2);
right = Point.ByCoordinates(base.X + 10, base.Y);
Line.ByStartPointEndPoint(bottom, top);
Line.ByStartPointEndPoint(base, right);

// Move function results to base point
vec = base.AsVector();
newPts = pts.Add(vec);

// Draw a line through the points
NurbsCurve.ByPoints(newPts);
# ----------------------------------------

# group: 使用节点创建余弦曲线 > 输入
# note: 基点 x,y 坐标
code_block_11 = CodeBlock { -5; 20; }
# note: X 值系列
code_block_12 = CodeBlock { 0..10..#20; }
# note: 频率
number_slider_9 = DoubleSlider(36, range=0..100 step 0.1)  # graph input

# group: 使用节点创建余弦曲线 > 控制振幅
# note: 振幅
number_slider_10 = DoubleSlider(3, range=0..10 step 0.1)  # graph input

# group: 使用节点创建余弦曲线
mul_2 = number_slider_9 * code_block_12

# group: 使用节点创建余弦曲线 > Math.Cos 函数
# 获取每个初始数的余弦值
cos = Math.Cos(angle=mul_2)

# group (continued): 使用节点创建余弦曲线
mul_3 = number_slider_10 * cos

# group: 使用节点创建余弦曲线 > 中间操作
byCoordinates_9 = Point.ByCoordinates(x=code_block_11.out0, y=code_block_11.out1)
# note: 提示: 可以针对构成几何图形的任何节点启用或禁用“预览”功能。单击鼠标右键，然后选中或取消选中“预览”。
byCoordinates_10 = Point.ByCoordinates(x=code_block_12, y=mul_3)

# group: 使用节点创建余弦曲线 > 创建和可视化余弦曲线
code_block_13 = CodeBlock(base=byCoordinates_9, pts=byCoordinates_10)  # same code as code_block_10

# group: 使用节点创建圆弧 > 输入
# 创建必要输入:
# 1. 中心点
# 2. 半径
# 3. 开始角度
# 4. 结束角度
# 5. 法线(ZAxsis)
code_block_14 = CodeBlock { 0; 35; }
byCoordinates_11 = Point.ByCoordinates(x=code_block_14.out0, y=code_block_14.out1)
code_block_15 = CodeBlock { 5; 0; }
# note: 移动滑块以更改圆弧的长度。
number_slider_11 = DoubleSlider(247.821, range=0..360 step 0.1)  # graph input
ZAxis = Vector.ZAxis()

# group: 使用节点创建圆弧 > 根据中心点、半径和角度创建圆弧
# note: 节点或代码块中的角度以弧度为单位。
byCenterPointRadiusAngle = Arc.ByCenterPointRadiusAngle(center=byCoordinates_11, radius=code_block_15.out0, startAngle=code_block_15.out1, endAngle=number_slider_11, normal=ZAxis)

# group: 使用节点创建圆弧 > 可视化输出
endPoint = Curve.EndPoint(curve=byCenterPointRadiusAngle)
byStartPointEndPoint = Line.ByStartPointEndPoint(startPoint=endPoint, endPoint=byCoordinates_11)
startPoint = Curve.StartPoint(curve=byCenterPointRadiusAngle)
byStartPointEndPoint_2 = Line.ByStartPointEndPoint(startPoint=startPoint, endPoint=byCoordinates_11)

# group: 使用节点的操作 > -
code_block_16 = CodeBlock { 5; 2; }
sub = code_block_16.out0 - code_block_16.out1
watch = Watch(sub)

# group: 使用代码块的操作 > -
code_block_17 = CodeBlock { 5-2; }
watch_2 = Watch(code_block_17)

# group: 使用代码块的操作 > %
code_block_18 = CodeBlock { 5%2; }
watch_3 = Watch(code_block_18)

# group: 使用节点的操作 > %
code_block_19 = CodeBlock { 5; 2; }
mod = code_block_19.out0 % code_block_19.out1
watch_4 = Watch(mod)

# group: 使用代码块的操作 > <=
code_block_20 = CodeBlock { 5<=2; }
watch_5 = Watch(code_block_20)

# group: 使用代码块的操作 > >
code_block_21 = CodeBlock { 5>2; }
watch_6 = Watch(code_block_21)

# group: 使用节点的操作 > <=
code_block_22 = CodeBlock { 5; 2; }
le = code_block_22.out0 <= code_block_22.out1
watch_7 = Watch(le)

# group: 使用节点的操作 > >
code_block_23 = CodeBlock { 5; 2; }
gt = code_block_23.out0 > code_block_23.out1
watch_8 = Watch(gt)

# group: 使用代码块创建圆弧 > 输入
# 创建必要输入:
# 1. 中心点
# 2. 结束角度
code_block_24 = CodeBlock { 15; 35; }
byCoordinates_12 = Point.ByCoordinates(x=code_block_24.out0, y=code_block_24.out1)
number_slider_12 = DoubleSlider(126.947, range=0..360 step 0.1)  # graph input

# group: 使用代码块创建圆弧 > 根据中心点、半径和角度创建圆弧
code_block_25 = CodeBlock(center=byCoordinates_12, endAngle=number_slider_12) { Arc.ByCenterPointRadiusAngle(center,5,0,endAngle,Vector.ZAxis()); }

# group: 使用代码块创建圆弧 > 可视化输出
startPoint_2 = Curve.StartPoint(curve=code_block_25)
byStartPointEndPoint_3 = Line.ByStartPointEndPoint(startPoint=startPoint_2, endPoint=byCoordinates_12)
endPoint_2 = Curve.EndPoint(curve=code_block_25)
byStartPointEndPoint_4 = Line.ByStartPointEndPoint(startPoint=endPoint_2, endPoint=byCoordinates_12)

# group: 使用节点舍入 > 输入
code_block_26 = CodeBlock { 3.14159; }
code_block_27 = CodeBlock { 3; }

# group: 使用节点舍入 > 下舍入
floor = Math.Floor(number=code_block_26)
watch_9 = Watch(floor)

# group: 使用节点舍入 > 上舍入
ceiling = Math.Ceiling(number=code_block_26)
watch_10 = Watch(ceiling)

# group: 使用节点舍入 > 上舍入或下舍入
# 哪个最接近
round = Math.Round(number=code_block_26)
watch_11 = Watch(round)

# group: 使用节点舍入 > 舍入到指定的位数
round_2 = Math.Round(number=code_block_26, digits=code_block_27)
watch_12 = Watch(round_2)

# group: 使用代码块舍入 > 输入
code_block_28 = CodeBlock { 3.14159; }

# group: 使用代码块舍入 > 下舍入
code_block_29 = CodeBlock(num=code_block_28) { Math.Floor(num); }
watch_13 = Watch(code_block_29)

# group: 使用代码块舍入 > 上舍入
code_block_30 = CodeBlock(num=code_block_28) { Math.Ceiling(num); }
watch_14 = Watch(code_block_30)

# group: 使用代码块舍入 > 上舍入或下舍入
# 哪个最接近
code_block_31 = CodeBlock(num=code_block_28) { Math.Round(num); }
watch_15 = Watch(code_block_31)

# group: 使用代码块舍入 > 舍入到指定的位数
# 说明 <双击此处编辑组说明>
code_block_32 = CodeBlock(num=code_block_28) { Math.Round(num,3); }
watch_16 = Watch(code_block_32)

# group: 使用代码块的操作 > ==(相等)
code_block_33 = CodeBlock { true == false; }
watch_17 = Watch(code_block_33)

# group: 使用代码块的操作 > 非
code_block_34 = CodeBlock { !true; }
watch_18 = Watch(code_block_34)

# group: 使用代码块的操作 > && (与)
code_block_35 = CodeBlock { true && false; }
watch_19 = Watch(code_block_35)

# group: 使用代码块的操作 > || (或)
code_block_36 = CodeBlock { true || false; }
watch_20 = Watch(code_block_36)

# group: 使用节点的操作 > ==(相等)
boolean = BoolSelector(true)  # graph input
boolean_2 = BoolSelector(false)  # graph input
eq = boolean == boolean_2
watch_21 = Watch(eq)

# group: 使用节点的操作 > || (或)
boolean_3 = BoolSelector(true)  # graph input
boolean_4 = BoolSelector(false)  # graph input
or_ = boolean_3 || boolean_4
watch_22 = Watch(or_)

# group: 使用节点的操作 > && (与)
boolean_5 = BoolSelector(true)  # graph input
boolean_6 = BoolSelector(false)  # graph input
and_ = boolean_5 && boolean_6
watch_23 = Watch(and_)

# group: 使用节点的操作 > 非
boolean_7 = BoolSelector(true)  # graph input
not_ = Not(x=boolean_7)
watch_24 = Watch(not_)
