# Dynamo graph Core_Python.dyn (Dynamo 4.1.0.2940)
# author: Dynamo Team
# 在 Dynamo 中使用 Python 节点

# group: 信息
# note: PYTHON
# Dynamo 通过两种类型的 Python 节点之一支持 CPython。(此处未显示的第二种类型的 Python 节点可以从要执行的外部文件中读取脚本。)
# 双击“Python”节点，即可查看其包含的脚本。
# 输入包含在“IN”数组中。输出必须指定给“OUT”变量。输出可以是单个值，也可以是数组本身。

# group: 使用 Python 节点对列表应用符号操作
# note: 该示例将加上或减去列表中的所有项。其输入内容是数字(数字的符号确定是使用加法还是减法)或数字列表。

# group: 选择正数、0 或负数
# 说明 <双击此处编辑组说明>
# note: 选择该符号进行运算
#     数字 < 0      减去每个
#     数字 = 0      0
#     数字 > 0      加上每个
integer_slider = IntegerSlider(1, range=-1..2 step 1)

# group: 创建输入列表
# note: 创建列表
code_block = CodeBlock { 0..10; }
watch = Watch(code_block)

# group: Python
# 应用符号操作
# note: 来自“OUT”变量的输出是一个数组，其中第一项是单个值，第二个项是值列表。Python 定义本身指定了该数据结构。指定数组使您能够将任意数量的输出发送到 Dynamo 图形。
python_script = Python(Sign=integer_slider, List=watch)  # PythonNet3
# ---------- python_script.python (31 lines) ----------
# Python script to find add or subtract a series of numbers. 

# Boiler-plate import statments included out-of-the-box
import clr
clr.AddReference('ProtoGeometry')
from Autodesk.DesignScript.Geometry import *

# The inputs to this node will be stored as a list in the IN variable.
sign = IN[0]  # -1 for subtract all, 0 for do nothing, 1 for add all
nums = IN[1]  # List of numbers to subtract or add

partials = [] # Empty array to contain partial sums or differences
result = 0    # Initialize the sum or difference to 0

# Loop through each item and add it or subtract it from the result.
for index in range(len(nums)):
	if sign > 0:
		result = result + nums[index]
		partials.append(result)
	elif sign == 0:
		partials.append(result)
		continue
	else:
		result = result - nums[index]
		partials.append(result)

# Assign the output to the OUT variable
#OUT = results  # Use this to output only the result.
OUT = []
OUT.append(result)
OUT.append(partials)
# ----------------------------------------

# group: 生成的列表
code_block_2 = CodeBlock { 1; }
getItemAtIndex = List.GetItemAtIndex(list=python_script, index=code_block_2)
# note: 部分结果的系列。
watch_2 = Watch(getItemAtIndex)

# group: 生成的总和
code_block_3 = CodeBlock { 0; }
getItemAtIndex_2 = List.GetItemAtIndex(list=python_script, index=code_block_3)
# note: 总结果。
watch_3 = Watch(getItemAtIndex_2)

# group: Python 几何图形创建
# note: 该 Python 示例没有输入内容。它说明了如何使用 Dynamo 的 protogeometry 库创建几何图形。由于 Python 节点创建可见几何图形，将其选中就像选择任何其他节点一样，将导致几何图形亮显。
python_script_2 = Python()  # PythonNet3
# ---------- python_script_2.python (24 lines) ----------
import clr
clr.AddReference('ProtoGeometry')
from Autodesk.DesignScript.Geometry import *
#The inputs to this node will be stored as a list in the IN variable.
dataEnteringNode = IN

p1 = Point.ByCoordinates(0, 0, 0);
p2 = Point.ByCoordinates(-10, -10, -10);

l = Line.ByStartPointEndPoint(p1, p2);

pts = [
	Point.ByCoordinates(0, 0, 0),
	Point.ByCoordinates(10, 10, 0),
	Point.ByCoordinates(20, 0, 0),
	Point.ByCoordinates(30, 10, 0),
	Point.ByCoordinates(40, 0, 0) ]
	
spline = NurbsCurve.ByPoints(pts)

surf = spline.Extrude(Vector.ByCoordinates(0, 0, 1), 10)

#Assign your output to the OUT variable
OUT = [l, spline, surf]
# ----------------------------------------

# group: 查看生成的输出
# note: 提示: 使用代码块
# 访问列表中的某些项。
code_block_4 = CodeBlock(output=python_script_2) { output[0]; output[1]; output[2]; }
watch_4 = Watch(code_block_4.out2)
watch_5 = Watch(code_block_4.out0)
watch_6 = Watch(code_block_4.out1)
