# Dynamo graph Core_RangeSyntax.dyn (Dynamo 3.0.0.6964)
# author: Dynamo Team
# 此图形提供了几种用于生成等间距数字或字符序列的方法。

# group: 信息
# note: 范围语法
# 有多种方法可以创建列表作为数字或字符序列。
# 在创建元素数组、迭代以及为各种函数和等式做准备时，序列会非常有用。

# group: 使用代码块
# note: start..end..step
# 从 0 到 10，步长为 2
# 此方法等同于使用“Range”节点
code_block = CodeBlock { 0..10..2; }
watch = Watch(code_block)
# note: start..end
# 当步长值未指定时，假定步长值为 1。
# 此方法等同于使用“Range”节点
# note: 在“Code Block”节点中使用范围语法。有几种方法可以生成一系列数字(或字符):
#         start..end..step
#         start..end..#amount
#         start..#amount..interval
# start = 序列开头的数字/字符
# end = 序列结尾的数字/字符
# step = 两个连续数字/字符之间的差值
# amount = 序列中数字/字符的个数
code_block_2 = CodeBlock { 0..10; }
watch_2 = Watch(code_block_2)
# note: start..end..#amount
# 从 0 到 10，步长为 3
code_block_3 = CodeBlock { 0..10..#3; }
watch_3 = Watch(code_block_3)
# note: start..#amount..interval
# 从 0 开始的 10 步，每个步长等于 3
# 此方法等同于使用“Sequence”节点
code_block_4 = CodeBlock { 0..#10..3; }
watch_4 = Watch(code_block_4)

# group: 将代码块与动态输入一起使用
integer_slider = IntegerSlider(7, range=0..10 step 1)
# note: 将值替换为变量，并使用滑块动态控制列表的长度。
code_block_5 = CodeBlock(howMany=integer_slider) { 0..#howMany..3; }
watch_5 = Watch(code_block_5)

# group: 使用 Sequence
number = DoubleInput(0)
number_slider = DoubleSlider(8, range=0..10 step 0.1)
number_2 = DoubleInput(2)
# note: 如果列表中的项数和每个步长已知，请使用“Sequence”节点。列表中的最后一个结果未预定义，而是根据其他输入进行计算。
# 示例: 设计一个可容纳 8 辆车的停车场，每个停车位的宽度都是已知的。所有停车位的总宽度取决于各个停车位的宽度和数量。
sequence = Sequence(start=number, amount=number_slider, step=number_2, lacing=Longest)
watch_6 = Watch(sequence)

# group: 使用 Range
number_3 = DoubleInput(0)
number_4 = DoubleInput(10)
number_slider_2 = DoubleSlider(1.75, range=0..10 step 0.1)
# note: 如果序列的开始和结束已知，请使用“Range”节点。结果列表中的项数未预定义，而是根据其他输入进行计算。
# 值得注意的是，如果 step 值在超过“end”一个额外步长时超出了“end”，则列表中的最后一项可能与“end”输入不匹配。
# 增加“start”和“end”设置之间的 step 值可能会减少项数；反之亦然，减少 step 会增加列表的长度。
range = Range(start=number_3, end=number_4, step=number_slider_2, lacing=Longest)
watch_7 = Watch(range)

# group: 使用 Range - 字符串
string = StringInput("A")
string_2 = StringInput("P")
code_block_6 = CodeBlock { 1; }
# note: “Range”也可用于生成字符序列！
range_2 = Range(start=string, end=string_2, step=code_block_6, lacing=Longest)
watch_8 = Watch(range_2)

# group: 使用 Sequence - 字符串
string_3 = StringInput("A")
code_block_7 = CodeBlock { 20; }
# note: 使用“Sequence”节点按字母顺序生成一系列字母
sequence_2 = Sequence(start=string_3, amount=code_block_7)
watch_9 = Watch(sequence_2)

# note: 使用值序列创建一系列点
byCoordinates = Point.ByCoordinates(x=code_block_5)
