# Dynamo graph Core_Strings.dyn (Dynamo 3.4.1.7055)
# author: Dynamo Team
# 此图形演示了可以对字符串执行的操作。

# group: 信息
# note: 字符串
# 此组示例演示了可以对字符串执行的一些操作。可以在节点库中的“String”类别下找到更多用于字符串操作的节点

byCoordinates = Point.ByCoordinates()
code_block = CodeBlock { 5; }
# note: 创建对象 - 圆
byCenterPointRadius = Circle.ByCenterPointRadius(centerPoint=byCoordinates, radius=code_block)

# group: 将对象转换为字符串
# note: 将对象转换为其自身的字符串说明。
string_from_object = FromObject(obj=byCenterPointRadius)

watch = Watch(string_from_object)

# group: 使用分隔符拆分字符串
code_block_2 = CodeBlock { "("; ")"; " "; "="; ","; }
# note: 通过指定一个或多个分隔符字符将字符串分割成多个部分。每个分隔符可以是一个或多个字符。
split = String.Split(string=watch, separator0=code_block_2.out0, separator1=code_block_2.out1, separator2=code_block_2.out2, separator3=code_block_2.out3, separator4=code_block_2.out4)

watch_2 = Watch(split)

# group: 检查字符串是否包含子字符串
code_block_3 = CodeBlock { "."; }
# note: 查找字符串是否包含另一字符串。
contains = String.Contains(string=watch_2, searchFor=code_block_3)

watch_3 = Watch(contains)

# group: 创建字符串
# note: 使用代码块创建字符串 - "" 标记分隔字符串值。
code_block_4 = CodeBlock { "Few things are harder to put up with than a good example."; }

# group: 更改为大写
string = StringInput(" - Mark Twain")
# note: 更改字符串的大小写
toUpper = String.ToUpper(string=string)
watch_4 = Watch(toUpper)

# group: 连接
# note: 将两个字符串连接为一个的操作被称为“concatenating”(合并)，或缩写为“Concat”。
concat = String.Concat(string0=code_block_4, string1=watch_4)

watch_5 = Watch(concat)

# group: 替换字符串中的字符
code_block_5 = CodeBlock { "put"; }
code_block_6 = CodeBlock { "come"; }
# note: 将所有出现的子字符串替换为替换字符串。
replace = String.Replace(string=watch_5, searchFor=code_block_5, replaceWith=code_block_6)

watch_6 = Watch(replace)

# group: 在字符串中查找子字符串
code_block_7 = CodeBlock { " to"; }
# note: 查找特定子字符串在字符串中的位置。结果是子字符串开始的索引。
indexOf = String.IndexOf(string=watch_6, searchFor=code_block_7)
watch_7 = Watch(indexOf)

# group: 字符串长度
# note: 查找字符串中的字符总数。
length = String.Length(string=watch_6)
watch_8 = Watch(length)

# note: 将字符串的第一部分从该字符串的总长度中减去
sub = watch_8 - watch_7

# group: 删除字符
# note: 删除字符串中一定数量的字符。
remove = String.Remove(string=watch_6, startIndex=watch_7, count=sub)

# group: 计数出现次数
watch_9 = Watch(remove)
code_block_8 = CodeBlock { "ar"; }
# note: 计数字符串内子字符串的出现次数。
countOccurrences = String.CountOccurrences(string=watch_9, searchFor=code_block_8)
watch_10 = Watch(countOccurrences)

# group: 创建字符串
# note: If the string includes a " character, use an escape character \ before " to treat it as a part of the string and not the end of the string.
code_block_9 = CodeBlock { "There is no \"I\" in Team"; }
watch_11 = Watch(code_block_9)

数字范围 = CodeBlock { 2..101; }

# group: 使用“Add”连接字符串
code_block_10 = CodeBlock { " Dalmatians"; }
# note: “Add”操作自动将数字转换为字符串并执行连接
add = 数字范围 + code_block_10
watch_12 = Watch(add)

# group: 将对象转换为字符串
# note: 在某些情况下，需要先将对象转换为字符串
string_from_object_2 = FromObject(object=数字范围)
watch_13 = Watch(string_from_object_2)
type = Object.Type(object=string_from_object_2)
watch_14 = Watch(type)

# group: 将字符串转换为数字
code_block_11 = CodeBlock { "101 Dalmatians"; }
code_block_12 = CodeBlock { " "; }
# note: 使用空格作为分隔符将字符串拆分为多个单词
split_2 = String.Split(string=code_block_11, separator0=code_block_12)
# note: 从列表中获取第一项
firstItem = List.FirstItem(list=split_2)
# note: 将字符串转换为数字
toNumber = String.ToNumber(string=firstItem)
watch_15 = Watch(toNumber)
type_2 = Object.Type(object=toNumber)
watch_16 = Watch(type_2)

# group: 将字符串转换为数字
# note: 使用布尔列表作为过滤器的掩码，以获取列表中的所有数字
filterByBoolMask = List.FilterByBoolMask(list=watch_2, mask=contains)
# note: 将字符串转换为数字
toNumber_2 = String.ToNumber(string=filterByBoolMask.in)

watch_17 = Watch(filterByBoolMask.in)
