# Dynamo graph Geometry_Curves.dyn (Dynamo 3.1.0.3411)
# author: Dynamo Team
# 演示如何创建基本曲线基元(直线、复合线、开放和闭合 Nurbs 曲线)的样例图形

# group: 信息
# note: 此图形演示了如何创建基本曲线基元 - 直线、复合线、开放和闭合 Nurbs 曲线

# group: 初始输入
number = DoubleInput(5)
number_2 = DoubleInput(10)
number_3 = DoubleInput(15)

# group: 初始 4 个点
byCoordinates = Point.ByCoordinates()
byCoordinates_2 = Point.ByCoordinates(y=number)
byCoordinates_3 = Point.ByCoordinates(x=number_2, y=number_2)
byCoordinates_4 = Point.ByCoordinates(x=number_3)

# group: 4 个点的列表
create = List.Create(item0=byCoordinates, item1=byCoordinates_2, item2=byCoordinates_3, item3=byCoordinates_4)

# group: Nurbs 曲线
# note: 根据 4 个点创建 Nurbs 曲线
byPoints = NurbsCurve.ByPoints(points=create)

# group: 直线
# note: 根据 2 个点创建一条直线
byStartPointEndPoint = Line.ByStartPointEndPoint(startPoint=byCoordinates, endPoint=byCoordinates_2)

length = Curve.Length(curve=byStartPointEndPoint)

# group: Nurbs 曲线 - 闭合
boolean = BoolSelector(true)
# note: 在边界点内创建闭合的 Nurbs 曲线
byControlPoints = NurbsCurve.ByControlPoints(points=create, closeCurve=boolean)

# group: 复合线
# 说明 <双击此处编辑组说明>
# note: 通过一组点创建直复合线
# note: 新建注释
byPoints_2 = PolyCurve.ByPoints(points=create)

# group: 操作和查询
code_block = CodeBlock { 0..1..#20; }
# note: 曲线、Polycurves (曲线集合)、Nurbs 和直线均源自于“曲线”，因此可以对它们进行所有相关的曲线“操作”和“查询”
pointAtParameter = Curve.PointAtParameter(curve=byPoints_2, param=code_block)
