# Dynamo graph Geometry_Points.dyn (Dynamo 3.1.0.3411)
# author: Dynamo Team
# 创建点数组

# group: 初始输入
number_slider = DoubleSlider(6.4, range=0..10 step 0.1)

# group: 单点
# note: 基本几何图元的默认值为数值输入。通过将光标悬停在节点输入端口上来检查默认值
byCoordinates = Point.ByCoordinates(z=number_slider)

# group: 预览结果
# note: 在点击“运行”后或在“自动运行”已启用的情况下，可在背景预览、Watch 3D 中查看几何图元，或在“Watch”节点中作为数据查看几何图元。选择节点后，图元将在背景中亮显
watch_3d = Watch3D(byCoordinates)

# group: 初始输入
number = DoubleInput(0)
number_2 = DoubleInput(10)
number_3 = DoubleInput(1)

# group: 数字范围
# note: 使用序列、范围和列表可创建几何图形数组
range = Range(start=number, end=number_2, step=number_3, lacing=Longest)

# group: 点矩阵
# note: 通过将范围传递到点 x、y 和 z 端口，然后更改节点右键单击菜单中的连缀特性，从而生成 1、2 和 3 维数组。当选择“叉积连缀”选项时，观察结果
byCoordinates_2 = Point.ByCoordinates(x=range, y=range, lacing=CrossProduct)

watch = Watch(byCoordinates)

# group: 将点转换为向量
# 说明 <双击此处编辑组说明>
# note: 某些图元可以轻松转换为其他图元
asVector = Point.AsVector(point=watch)

# group: 将矩阵作为向量逐点移动
# note: 在实体的“操作”子目录中使用工具，可以创建导数图元
add = Point.Add(point=byCoordinates_2, vectorToAdd=asVector)

# group: 预览“Z”点坐标
# note: 可以使用每个节点编组的“查询”子类别中的节点(问号符号旁边)从几何图形中提取信息
Z = Point.Z(point=byCoordinates)
