# Dynamo graph Geometry_Solids.dyn (Dynamo 3.1.0.3411)
# author: Dynamo Team
# 演示实体创建(使用放样)和实体操作(添加和减去)的 Dynamo 样例图形

# group: 第一组曲线的初始点
byCoordinates = Point.ByCoordinates()
number = DoubleInput(10)
byCoordinates_2 = Point.ByCoordinates(x=number)
byCoordinates_3 = Point.ByCoordinates(y=number)

# group: 第二组曲线的附加点
number_2 = DoubleInput(5)
byCoordinates_4 = Point.ByCoordinates(z=number_2)

# group: 为底部基础创建初始曲线
byStartPointEndPoint = Line.ByStartPointEndPoint(startPoint=byCoordinates, endPoint=byCoordinates_2)
byThreePoints = Arc.ByThreePoints(firstPoint=byCoordinates, secondPoint=byCoordinates_4, thirdPoint=byCoordinates_2)

# group: 创建底部基准
create = List.Create(item0=byStartPointEndPoint, item1=byThreePoints)
byJoinedCurves = PolyCurve.ByJoinedCurves(curves=create)

# group: 第三组曲线的附加点
number_3 = DoubleInput(15)
byCoordinates_5 = Point.ByCoordinates(x=number_3, y=number_3)

# group: 第四组曲线的附加点
number_4 = DoubleInput(5)
number_5 = DoubleInput(10)
byCoordinates_6 = Point.ByCoordinates(x=number_4, y=number_5, z=number_5)

# group: 为顶部基准创建初始曲线
byStartPointEndPoint_2 = Line.ByStartPointEndPoint(startPoint=byCoordinates_3, endPoint=byCoordinates_5)
byThreePoints_2 = Arc.ByThreePoints(firstPoint=byCoordinates_3, secondPoint=byCoordinates_6, thirdPoint=byCoordinates_5)

# group: 创建顶部基准
create_2 = List.Create(item0=byStartPointEndPoint_2, item1=byThreePoints_2)
byJoinedCurves_2 = PolyCurve.ByJoinedCurves(curves=create_2)

# group: 将基准曲线合并到列表中
create_3 = List.Create(item0=byJoinedCurves, item1=byJoinedCurves_2)

# group: 放样
# note: 大多数实体有多种创建方法。这些示例将闭合轮廓显示为基础，但多重曲面可以缝合，并可使用许多基本体(曲面、长方体、圆锥体等等)
byLoft = Solid.ByLoft(crossSections=create_3)

# group: 体积
# note: 可以检查放样的体积，以证明它是闭合的实体几何图形
volume = Solid.Volume(solid=byLoft)

# group: 其他放样几何图形的附加点
number_6 = DoubleInput(-2)
number_7 = DoubleInput(5)
byCoordinates_7 = Point.ByCoordinates(x=number_6, y=number_7)

# group: 将点合并到列表中
create_4 = List.Create(item0=byCoordinates, item1=byCoordinates_7, item2=byCoordinates_3)

# group: 创建其他基准曲线
# 说明 <双击此处编辑组说明>
# note: 此次根据一组点创建 Nurbse 曲线
byPoints = NurbsCurve.ByPoints(points=create_4)

# group: 放样 +
# note: 提示: 禁用节点右键菜单中的“预览”，以禁止显示图元
byLoft_2 = Solid.ByLoft(crossSections=create_3, guideCurves=byPoints)

# group: 几何图形 +
code_block = CodeBlock { Vector.ByCoordinates(-20,0,0); }
# note: 移动几何图形以可视化输出
translate = Geometry.Translate(geometry=byLoft_2, direction=code_block)

# group: 准备“成分”以修剪实体几何图形
# note: 厚度
code_block_2 = CodeBlock { 0; }
# note: 提示: 禁用节点右键菜单中的“预览”，以禁止显示图元
thinShell = Solid.ThinShell(solid=byLoft, internalFaceThickness=code_block_2)
code_block_3 = CodeBlock { Vector.ByCoordinates(20,0,0); }
# note: 将几何图形在 X 方向上移动 20 个单位
translate_2 = Geometry.Translate(geometry=thinShell, direction=code_block_3)
code_block_4 = CodeBlock { Point.ByCoordinates(0,0,5); }
ZAxis = Vector.ZAxis()
# note: 创建穿过实体要进行剪切的平面
byOriginNormal = Plane.ByOriginNormal(origin=code_block_4, normal=ZAxis)
# note: 此点确定要修剪的实体部分
code_block_5 = CodeBlock { Point.ByCoordinates(10,10,10); }

# group: 放样 -
# note: 几何图形类别中可使用几何图形各项布尔运算(交集、差集、并集等)。
trim = Geometry.Trim(geometry=translate_2, other=byOriginNormal, pick=code_block_5)
