# Dynamo graph Geometry_Surfaces.dyn (Dynamo 3.1.0.3411)
# 演示创建曲面的主要方法(拉伸、放样、扫掠)的 Dynamo 图形。

# group: 信息
# note: 演示创建曲面的主要方法(拉伸、放样、扫掠)的 Dynamo 图形

# group: 输入
number = DoubleInput(10)
number_2 = DoubleInput(-10)
byCoordinates = Point.ByCoordinates(x=number, y=number_2)
byCoordinates_2 = Point.ByCoordinates(y=number_2)

# group: 直线
byStartPointEndPoint = Line.ByStartPointEndPoint(startPoint=byCoordinates, endPoint=byCoordinates_2)

# group: 输入
byCoordinates_3 = Point.ByCoordinates()

# group: 输入
number_3 = DoubleInput(5)
byCoordinates_4 = Point.ByCoordinates(z=number_3)

# group: 输入
number_4 = DoubleInput(10)
byCoordinates_5 = Point.ByCoordinates(x=number_4)
byCoordinates_6 = Point.ByCoordinates(y=number_4)

# group: 圆弧
byThreePoints = Arc.ByThreePoints(firstPoint=byCoordinates_3, secondPoint=byCoordinates_4, thirdPoint=byCoordinates_5)

# group: 放样
create = List.Create(item0=byStartPointEndPoint, item1=byThreePoints)
# note: 通过使用 2 组曲线，我们可以在它们之间创建“放样”几何图形
byLoft = Surface.ByLoft(crossSections=create)

# group: 评估放样面积
area = Surface.Area(surface=byLoft)
watch = Watch(area)

# group: 输入
number_5 = DoubleInput(5)
number_6 = DoubleInput(10)
byCoordinates_7 = Point.ByCoordinates(x=number_5, y=number_6, z=number_6)

# group: 输入
number_7 = DoubleInput(15)
byCoordinates_8 = Point.ByCoordinates(x=number_7, y=number_7)

# group: 圆弧
byThreePoints_2 = Arc.ByThreePoints(firstPoint=byCoordinates_6, secondPoint=byCoordinates_7, thirdPoint=byCoordinates_8)

# group: 输入
number_8 = DoubleInput(-5)
number_9 = DoubleInput(5)
byCoordinates_9 = Point.ByCoordinates(x=number_8, y=number_9)

# group: 圆弧
byThreePoints_3 = Arc.ByThreePoints(firstPoint=byCoordinates_3, secondPoint=byCoordinates_9, thirdPoint=byCoordinates_6)

# group: 扫掠
# note: 大多数曲面有多种创建方法。通过点、曲线和从其他曲面和实体提取的数据可创建曲面、Polysurfaces (曲面集合)和 Nurbs 曲面
bySweep2Rails = Surface.BySweep2Rails(path=byThreePoints_2, guideRail=byThreePoints, profile=byThreePoints_3)

# group: 合并放样和扫掠
create_2 = List.Create(item0=byLoft, item1=bySweep2Rails)
# note: 已连接为 Polysurfaces 的曲面可以作为单个实体计算
byJoinedSurfaces = PolySurface.ByJoinedSurfaces(surfaces=create_2)

# group: 评估放样和扫掠的合并面积
area_2 = Surface.Area(surface=byJoinedSurfaces)
watch_2 = Watch(area_2)

# group: 评估扫掠面积
area_3 = Surface.Area(surface=bySweep2Rails)
watch_3 = Watch(area_3)

# group: 从曲面中提取点并使用
code_block = CodeBlock { 0..1..0.1; }
# note: 使用适合这些几何图形的“操作”，可由曲面提取边、点和其他要素
pointAtParameter = Surface.PointAtParameter(surface=bySweep2Rails, u=code_block, v=code_block, lacing=CrossProduct)
# note: 通过提取的参数(点)创建新的 Nurbs 曲面。隐藏其余几何图形以观察下面几何图形的结果。
byControlPoints = NurbsSurface.ByControlPoints(controlVertices=pointAtParameter)
watch_3d = Watch3D(byControlPoints)

# group: 拉伸
code_block_2 = CodeBlock { 10; }
# note: 根据提供的曲线进行基本拉伸
extrude = Curve.Extrude(curve=byThreePoints_2, distance=code_block_2)
