# Dynamo graph ImportExport_CSV to Stuff.dyn (Dynamo 3.1.0.3411)
# author: Dynamo Team
# 根据解析的 csv 数据创建几何图形

# group: 初始 helix.csv 输入
# note: 浏览在 X、Y 和 Z 轴坐标空间具有数字
# 的 CSV 文件
file_path = Filename("..\..\Data\helix.csv")

# group: 读取文件
fromPath = FileObject(path=file_path)  # "File.FromPath"
readText = FileSystem.ReadText(file=fromPath)

# group: 解析 csv 数据
string = StringInput("\n")
# note: 以回车符<enter>
# 拆分字符串
split = String.Split(string=readText, separator0=string)
string_2 = StringInput(",")
# note: 以逗号分隔字符串
split_2 = String.Split(string=split, separator0=string_2)
# note: CSV 文件提供字符串，而不是数字
toNumber = String.ToNumber(string=split_2)
# note: 分组 X、Y 和 Z 分量
transpose = List.Transpose(lists=toNumber)

# group: 根据从 csv 文件中检索到的点创建“螺旋”几何图形
# note: “X”坐标
firstItem = List.FirstItem(list=transpose)
code_block = CodeBlock { 1; }
# note: “Y”坐标
getItemAtIndex = List.GetItemAtIndex(list=transpose, index=code_block)
# note: “Z”坐标
lastItem = List.LastItem(list=transpose)
byCoordinates = Point.ByCoordinates(x=firstItem, y=getItemAtIndex, z=lastItem)

# group: 按比例放大
number_slider = DoubleSlider(2.337, range=0..20 step 0.1)
# note: 调整坐标点的
# 总分布
scale = Geometry.Scale(geometry=byCoordinates, amount=number_slider, lacing=Longest)
