# Dynamo graph ImportExport_Excel to Dynamo.dyn (Dynamo 3.1.0.3411)
# author: Dynamo Team
# 演示如何将 Excel 中的数据输入到 Dynamo 中的样例图形。

# group: 初始输入
# note: 浏览到要根据其加载数据的 .xlsx Excel 文件路径。
file_path = Filename("..\..\Data\helix.xlsx")
# note: 根据文件路径获取文件。
fromPath = FileObject(path=file_path)  # "File.FromPath"
# note: Excel 中包含我们要输入数据的工作表的名称。
string = StringInput("helix")

# group: 输入 Excel 数据
# note: 此节点可以读取来自 Excel 工作表的数据。它将从所有列和行中读取，其结果数据将包含在双数组 [][] (矩阵)中。
importExcel = Data.ImportExcel(file=fromPath, sheetName=string)

# group: 转置
# note: 翻转(转置)列表(矩阵)。列变为行，行变为列。
transpose = List.Transpose(lists=importExcel)

# group: 提取点的坐标
number = DoubleInput(0)
# note: X 轴坐标
getItemAtIndex = List.GetItemAtIndex(list=transpose, index=number)
number_2 = DoubleInput(1)
# note: Y 轴坐标
getItemAtIndex_2 = List.GetItemAtIndex(list=transpose, index=number_2)
number_3 = DoubleInput(2)
# note: Z 轴坐标
getItemAtIndex_3 = List.GetItemAtIndex(list=transpose, index=number_3)

# group: 根据从 Excel 中提取的数据构建螺旋线
byCoordinates = Point.ByCoordinates(x=getItemAtIndex, y=getItemAtIndex_2, z=getItemAtIndex_3, lacing=Longest)
