# Dynamo graph OpenXMLExport_Data To Excel.dyn "OpenXMLExport_Data 至 Excel" (Dynamo 3.0.3.7594)
# author: Dynamo Team
# 演示如何将数据输出到 Excel 的 Dynamo 样例图形。

# group: 初始输入
# note: 驱动点数。将其视为螺旋线的“高度”。
number_slider = DoubleSlider(1.7, range=0..5 step 0.1)

# group: 创建螺旋线
# note: 从 0 开始创建一系列数字。增量为 10。点数乘以 360，因此如果“numCircles”输入为 1，则结果为 37 个数字(0 到 360)，我们将获取螺旋线的完整旋转。
code_block = CodeBlock(numCircles=number_slider) { 0..(360*numCircles)..10; }
# note: 余弦函数
cos = Math.Cos(angle=code_block, lacing=Longest)
# note: 正弦函数
sin = Math.Sin(angle=code_block, lacing=Longest)
# note: 除以 100
code_block_2 = CodeBlock(x=code_block) { x/100; }
# note: 创建点列表，X 分量是余弦，Y 分量是正弦，Z 是初始值除以 100。
byCoordinates = Point.ByCoordinates(x=cos, y=sin, z=code_block_2, lacing=Longest)
# note: 根据点列表创建列表结构 - 结果是一个包含 3 个列表([][] - 双数组)的列表，每个列表都分别包含 X、Y 和 Z 点坐标。
code_block_3 = CodeBlock(pt=byCoordinates) { [pt.X,pt.Y,pt.Z]; }

# group: 创建要输出的输入
# 1. csv 文件的文件路径。
# 2. 工作表的名称。
# 3. 点的转置列表。
# 4. Excel 中行和列的起始索引。
# note: xlsx 文件的文件路径。
file_path = Filename("..\..\Data\icosohedron_points.xlsx")
# note: Excel 中工作表的名称。
string = StringInput("helix")
# note: 翻转矩阵(转置列表)。列将变为行，行变为列。
transpose = List.Transpose(lists=code_block_3)
# note: 开始在 Excel 中记录数据的列/行数
number = DoubleInput(0)

# group: 将数据输出到 Excel 文件
# note: 将数据输出到 Excel
openXMLExportExcel = Data.OpenXMLExportExcel(filePath=file_path, sheetName=string, data=transpose, startRow=number, startColumn=number)
