# Dynamo graph OpenXMLImport_Data From Excel.dyn "来自 Excel 的 OpenXMLImport_Data" (Dynamo 3.1.0.3411)
# author: Dynamo Team
# 演示如何从 Excel 文件输入数据的样例图形。

# group: 初始输入
# 1. Excel 文件的文件路径。
# 2. 工作表的名称
file_path = Filename("..\..\Data\helix.xlsx")
string = StringInput("helix")

# group: 从 Excel 提取数据
# note: 从 Excel 读取数据
openXMLImportExcel = Data.OpenXMLImportExcel(filePath=file_path, sheetName=string)

# group: 解析 Excel 中的数据
# “解析”数据是操纵数据源的过程，从而使数据在使用之前成为环境的原生数据。
# note: 转置列表(翻转矩阵)。列将变为行，行变为列。
transpose = List.Transpose(lists=openXMLImportExcel)
# note: 第一个列表
number = DoubleInput(0)
# note: 第二个列表
number_2 = DoubleInput(1)
# note: 第三个列表
number_3 = DoubleInput(2)

# group: 创建螺旋线
# note: X 轴坐标
getItemAtIndex = List.GetItemAtIndex(list=transpose, index=number)
# note: Y 轴坐标
getItemAtIndex_2 = List.GetItemAtIndex(list=transpose, index=number_2)
# note: Z 轴坐标
getItemAtIndex_3 = List.GetItemAtIndex(list=transpose, index=number_3)
byCoordinates = Point.ByCoordinates(x=getItemAtIndex, y=getItemAtIndex_2, z=getItemAtIndex_3, lacing=Longest)
