# Dynamo graph Basics_Basic01.dyn (Dynamo 2.19.3.6543)
# author: Dynamo Team
# 連接節點以增加兩個數字

# note: 可以選取基本功能輸入 (如號碼和字串)，方法為從圖元區左邊的資源庫瀏覽或搜尋。
# 也可以在資源庫中找到要對資料執行的作業，如數學或幾何圖形轉換
# note: Dynamo 是一種視覺程式設計語言。與其他語言一樣，其運作方式為將簡單元素連結在一起，以形成更複雜的想法
# note: 從 Number 節點上的「>」埠拉出連接器，並將其連接至 + 節點上的「Y」埠，然後按一下應用程式左下角的「執行」按鈕。
number = DoubleInput(2)  # graph input
add = number + _  # unwired: y
# note: 您可以按一下應用程式右下角的「執行」按鈕視覺化資料。如果啟用「自動」執行模式，應用程式將會持續更新。
# 您可以使用 Watch 節點或按一下大多數節點底部的小正方形查看資料。
watch = Watch(add)
# note: 更多範例檔可在「說明」功能表中找到，或按一下頁籤上的 "X" 關閉此檔案，來返回歡迎使用頁面
number_2 = DoubleInput(6)  # graph input
