# Dynamo graph Basics_Basic02.dyn (Dynamo 2.19.3.6543)
# author: Dynamo Team
# 連接兩點建立一條直線

# note: 在 Dynamo 環境中操控點的位置: 選取 Point.ByCoordinates 節點，然後切換至背景預覽，沿點的三個軸拉動點。
byCoordinates = Point.ByCoordinates()
# note: 可將幾何資料視覺化為文字資訊 3D 空間
watch = Watch(byCoordinates)
number = DoubleInput(2)  # graph input
# note: 使用 Number Slider 或 Integer Slider 節點動態輸入指定範圍內的值。按一下藍色下拉箭頭可開啟數值範圍設定
number_slider = DoubleSlider(4.43, range=0..10 step 0.1)  # graph input
# note: 您可以使用螢幕右上角的按鈕 (Ctrl + B 快速鍵) 在「3D 背景」導覽和「圖表視圖」導覽之間切換。也可以在 Dynamo 和 Revit 的「視圖」功能表中開啟和關閉「背景預覽」。
byCoordinates_2 = Point.ByCoordinates(x=number, z=number_slider)
byStartPointEndPoint = Line.ByStartPointEndPoint(startPoint=byCoordinates_2, endPoint=byCoordinates)
# note: 使用 Watch 3D 節點以隔離方式視覺化 3D 元素
watch_3d = Watch3D(byStartPointEndPoint)
