# Dynamo graph Basics_Basic03.dyn (Dynamo 2.19.3.6543)
# author: Dynamo Team
# 建立簡單清單

# group: 輸入
# note: 資料清單可與順序和範圍一起產生。這些清單可以基於特定用途與其他許多節點一起重組
number = DoubleInput(0)  # graph input
number_2 = DoubleInput(9)  # graph input
number_3 = DoubleInput(1)  # graph input

# note: 建立從 Start 開始到 End，具有給定 Step 的一系列數字
range = Range(start=number, end=number_2, step=number_3, lacing=Longest)
watch = Watch(range)
number_4 = DoubleInput(3)  # graph input
# note: 以 3 的長度切割清單
chop = List.Chop(list=range, lengths=number_4)
# note: 透過 Watch 節點的協助預覽結果並觀察清單結構
watch_2 = Watch(chop)
# note: 取得清單中的最後一個項目
lastItem = List.LastItem(list=range)
watch_3 = Watch(lastItem)
