# Dynamo graph Core_AttractorPoint.dyn (Dynamo 3.0.0.6964)
# author: Dynamo Team
# 此圖表會建立圓柱格線，大小由牽引點的位置決定。

# group: 資訊
# note: 牽引點
# 牽引點是影響系統中其他元素特性的參考點 (也稱為元素)。牽引點的運作方式通常類似磁鐵 - 元素越接近牽引點，受牽引點的影響程度越大。
# 在此範例中，圓柱的高度和直徑由每個圓柱與移動的牽引點之間的距離決定。越靠近牽引點的圓柱越小。
# 若要視覺化此行為，請移動 Attractor point 輸入的兩個數字滑棒。
# 牽引點是一種在設計過程中引入回應程度和動態行為的方式。

# group: 點格線大小
# note: 使用 Code Block 建立一系列數字。此案例會建立一個從 1 到 50，共有 n 步，每一步為 5 的數字順序
數字範圍 = CodeBlock { 1..50..5; }

# group: 建立點格線
# note: 點格線。
# 若要建立，請將一系列數字傳遞至兩個埠 - X 座標和 Y 座標。在節點上按一下右鍵，將「交織」變更為「笛卡兒積」
# note: 節點的笛卡兒積交織會將一個清單中的每個項目與其他每個清單中的每個項目結合，產生一個格線狀的清單結構。
# 如果與「Point.ByCoordinates」節點的 X 輸入和 Y 輸入搭配使用，結果是一個平面的點格線。如果使用第三個 Z 座標，結果則是一個立方體的點格線。
byCoordinates = Point.ByCoordinates(x=數字範圍, y=數字範圍, lacing=CrossProduct)

# group: 展開清單結構
# 對點進一步操作不需要複雜的清單結構。請使用 Flatten 只產生一個清單。
# note: 展開清單，因為不需要列和欄的架構。請比較此節點的輸入與輸出 - N 個清單的結構變更為一個清單。
flatten = List.Flatten(list=byCoordinates)

# group: 牽引點位置
number_slider = DoubleSlider(24.6, range=-10..60 step 0.1)  # graph input
number_slider_2 = DoubleSlider(11.50111001, range=-10..60 step 0.1)  # graph input
# note: 牽引點。移動輸入滑棒以調整此點的位置。
byCoordinates_2 = Point.ByCoordinates(x=number_slider, y=number_slider_2)

# group: 與牽引點的距離
# note: 尋找牽引點與圓柱的每個基準點之間的距離
distanceTo = Geometry.DistanceTo(geometry=flatten, other=byCoordinates_2)

# group: 產生半徑和高度
# note: 讓圓柱高度對牽引點位置做反應的公式。在此範例中，每個圓柱的高度是與牽引點距離的一半。請試用不同公式。
圓柱高度 = CodeBlock(x=distanceTo) { x/2; }
# note: 公式會傳回一個值用作圓柱的半徑。距離越大 - 每個圓柱的半徑越大。請試用不同公式。
圓柱半徑 = CodeBlock(x=distanceTo) { x/15; }

# group: 終點
# 將每個圓柱的起點 (原點) 平移由公式定義的給定高度
# note: 將基準點 (原點) 向上移動給定值的向量
byCoordinates_3 = Vector.ByCoordinates(z=圓柱高度)
# note: 將此新的 Z 值 (高度) 加到原始格線點中，以取得圓柱的頂點。
add = Point.Add(point=flatten, vectorToAdd=byCoordinates_3)

# group: 建立圓柱
# note: 使用方法建立一個具有給定起點和終點，以及給定半徑的圓柱
byPointsRadius = Cylinder.ByPointsRadius(startPoint=flatten, endPoint=add, radius=圓柱半徑)
