# Dynamo graph Core_CodeBlocks.dyn (Dynamo 3.4.1.7055)
# author: Dynamo Team
# 此圖表會探索 Code Block 的各種使用方式和應用

# group: 資訊
# note: Code Block
# 在圖元區中按兩下可建立 Code Block。也可以在「Script」>「Editor」品類下的 Library 節點中找到 Code Block。
# Code Block 可以包含:
# •  數值 (整數和浮點數數字)
# •  字串 (文字)
# •  布林值 (True 或 False)
# •  清單 [0,1,2]
# •  表示式 (a+3)
# •  變數
# 其他節點可轉換為 Code Block 表示式: 選取一個或多個節點，然後在節點之間的空間按一下右鍵，選取「將節點轉換為程式碼」。這個動作無法反向，亦即無法將 Code Block 自動轉換為節點。

# group: 作為 Code Block 的節點
# note: Code Block 可以用來呼叫資源庫中的其他任何節點。資源庫中的節點通常有三種類型:
#     建立:		建立物件
#     動作:		對物件執行動作
#     查詢:		取得已存在物件
# 		的性質
# 在 Code Block 內呼叫時，這三種類型的方法 (或稱為節點) 有不同的處理方式。

# group: 建立幾何圖形
# note: 這些陳述式一起構成演算法，在基準點建立螺旋曲線。
code_block = CodeBlock()
# ---------- code_block.designscript (16 lines) ----------
// Basic inputs
base = Point.ByCoordinates(3,3);
coils = 3;
height = 5;
rad = 0.5;

// Make a series of points
numPts = 8*coils + 1;
seq = 0..(coils*360)..#numPts;
x = rad * Math.Cos(seq);
y = rad * Math.Sin(seq);
z = 0..height..#numPts;
pts = Point.ByCoordinates(x + base.X, y + base.Y, z + base.Z);

// Pass a curve through those points
NurbsCurve.ByPoints(pts);
# ----------------------------------------
# note: 螺旋演算法會轉換為函數，方法為給與它名稱、指定輸入，並告知它傳回什麼。
code_block_2 = CodeBlock()
# ---------- code_block_2.designscript (13 lines) ----------
def MakeSpring(base,coils,height,rad)
{
// Make a series of points
numPts = 8*coils + 1;
seq = 0..(coils*360)..#numPts;
x = rad * Math.Cos(seq);
y = rad * Math.Sin(seq);
z = 0..height..#numPts;
pts = Point.ByCoordinates(x + base.X, y + base.Y, z + base.Z);

// Return the curve that passes through those points
return = NurbsCurve.ByPoints(pts);
};
# ----------------------------------------
code_block_3 = CodeBlock { 0..6..2; }
code_block_4 = CodeBlock { 10..20..2; }
# note: 螺旋演算法會進行轉換，以定義具有任意名稱 "MakeSpring" 的函數。會呼叫此函數，以產生數個具有隨機高度且依格線排列的彈簧。
# note: 製作格線
byCoordinates = Point.ByCoordinates(x=code_block_3, y=code_block_4, lacing=CrossProduct)
flatten = List.Flatten(list=byCoordinates)
code_block_5 = CodeBlock { 5; }
count = List.Count(list=flatten)
# note: 為彈簧高度製作一系列隨機數字 (5 的倍數)
randomList = Math.RandomList(amount=count)
code_block_6 = CodeBlock(random=randomList) { random * 5; }
# note: 函數呼叫的輸入可以利用事項或單值項目的清單來產生。資料可以透過連接埠來傳遞或直接宣告，如 "0.5" 代表所有彈簧的半徑。
code_block_7 = CodeBlock(basePoints=flatten, numCoils=code_block_5, height=code_block_6) { MakeSpring(basePoints,numCoils,height,0.5); }

# group: 函數
# note: 函數可以直接定義在 Code Block 節點中，以便可在此定義的其他位置呼叫它們。
# 第一行具有關鍵字 "def"，接著函數名稱，再來以括號括住的輸入。
# 大括號定義函數的本體。每條線必須以分號結束。
# 利用 "return = " 傳回一值。
code_block_8 = CodeBlock()
# ---------- code_block_8.designscript (11 lines) ----------
/* This is a multi-line comment,
     which continues for mulitple
     lines. */

def FunctionName(input1, input2)
{
// This is a comment
sum = input1 + input2;

return = sum;
};
# ----------------------------------------
code_block_9 = CodeBlock { 1; }
# note: 定義函數的 Code Block 節點沒有輸入或輸出連接埠，因為是從其他 Code Block 節點呼叫它們。
code_block_10 = CodeBlock { 2; }
# note: 使用同一檔案中的另一個 Code Block 節點來呼叫函數，方法為給與相同的名稱和相同的引數數目。
code_block_11 = CodeBlock(in1=code_block_9, in2=code_block_10) { FunctionName(in1,in2); }
watch = Watch(code_block_11)
code_block_12 = CodeBlock { "cat"; }
code_block_13 = CodeBlock { "dog"; }
# note: 輸入引數的類型未指定在函數定義中，因此無論它收到什麼，都會處理它們。
code_block_14 = CodeBlock(in1=code_block_12, in2=code_block_13) { FunctionName(in1,in2); }
watch_2 = Watch(code_block_14)
origin = Point.Origin()
code_block_15 = CodeBlock { 16; }
# note: 函數呼叫具有的輸入若對該函數無意義，將給與空值結果。
code_block_16 = CodeBlock(in1=origin, in2=code_block_15) { FunctionName(in1,in2); }
watch_3 = Watch(code_block_16)

# group: 數值
# 比較專門建置的節點與 Code Block
# note: 專門建置
number = DoubleInput(3.14)
結果 = Watch(number)
# note: Code Block
code_block_17 = CodeBlock { 3.140; }
watch_4 = Watch(code_block_17)

# group: 字串值
# 比較專門建置的節點與 Code Block
# note: 專門建置
string = StringInput("Less is more.")
結果_2 = Watch(string)
# note: 在 Code Block 節點中請使用 "" 引號標出字串
code_block_18 = CodeBlock { "Less is more."; }
watch_5 = Watch(code_block_18)
# note: 使用此節點可檢視輸出值類型
type = Object.Type(object=code_block_18)
watch_6 = Watch(type)

# group: 表示式
# 使用專門建置的 * 節點和 Code Block 執行乘法運算
number_2 = DoubleInput(3)
number_3 = DoubleInput(5)
# note: 使用 * 節點將兩個數字相乘
mul = number_2 * number_3
結果_3 = Watch(mul)
# note: 使用 Code Block 執行乘法
code_block_19 = CodeBlock { 3*5; }
watch_7 = Watch(code_block_19)
code_block_20 = CodeBlock { 3; }
code_block_21 = CodeBlock { 5; }
# note: 使用變數作為乘法運算的輸入。
code_block_22 = CodeBlock(a=code_block_20, b=code_block_21) { a*b; }
watch_8 = Watch(code_block_22)

# group: 查詢
# 查詢並傳回物件性質的方法
# note: 使用 Code Block 時，使用者可以彈性決定如何指定輸入。這裡有幾種不同方式，例如，產生相同點。
code_block_23 = CodeBlock { 10; }
code_block_24 = CodeBlock { -10; }
# note: 使用 Point.ByCoordinates 節點的即裝即用方法
byCoordinates_2 = Point.ByCoordinates(x=code_block_23, y=code_block_24)
watch_9 = Watch(byCoordinates_2)
# note: Code Block 使用 Point.ByCoordinates 方法搭配 X、Y、Z 三個變數，其中 Z 在同一個 Code Block 中定義，並以分號「;」符號分隔
code_block_25 = CodeBlock(x=code_block_23, y=code_block_24) { z = 0; Point.ByCoordinates(x,y,z); }
watch_10 = Watch(code_block_25.out1)
code_block_26 = CodeBlock { Point.ByCoordinates(10,0,0); }
# note: 相當於同樣方法的 Code Block。查詢方法不需要括弧
code_block_27 = CodeBlock(pt=code_block_26) { pt.X; }
watch_11 = Watch(code_block_27)
# note: 傳回點 X 座標的即裝即用查詢方法
X = Point.X(point=code_block_26)
watch_12 = Watch(X)
# note: 此處使用相同數值之負值的公式已整合到輸入變數的表示法中
code_block_28 = CodeBlock(num=code_block_23) { Point.ByCoordinates(num,-num,0); }
watch_13 = Watch(code_block_28)
# note: Code Block 使用 Point.ByCoordinates 方法，以輸入提供所有三個變數
code_block_29 = CodeBlock { Point.ByCoordinates(10,-10,0); }
watch_14 = Watch(code_block_29)

# group: 建立
# 建立幾何圖形、清單、Revit 元素或其他物件的方法
# note: 在原點處建立點的即裝即用方法
origin_2 = Point.Origin()
watch_15 = Watch(origin_2)
# note: 雖然此方法不需要輸入，但需要括弧
code_block_30 = CodeBlock { Point.Origin(); }
watch_16 = Watch(code_block_30)
code_block_31 = CodeBlock { 0; -10; }
# note: 透過提供 X 座標和 Y 座標建立點的即裝即用方法
byCoordinates_3 = Point.ByCoordinates(x=code_block_31.out0, y=code_block_31.out1)
watch_17 = Watch(byCoordinates_3)
# note: 使用 Code Block 複製 Point.ByCoordinates 節點行為。如果將滑鼠懸停在原始的即裝即用節點上，您會找到方法名稱: 工具提示視窗底部會提到方法。
# 輸入的順序必須按照即裝即用節點中找到的順序指定。
code_block_32 = CodeBlock { Point.ByCoordinates(0,-10); }
watch_18 = Watch(code_block_32)

# group: 動作
# 對物件執行動作的方法
origin_3 = Point.Origin()
ZAxis = Vector.ZAxis()
# note: 對點加上向量的即裝即用方法
add = Point.Add(point=origin_3, vectorToAdd=ZAxis)
watch_19 = Watch(add)
origin_4 = Point.Origin()
ZAxis_2 = Vector.ZAxis()
# note: 動作方法是對物件執行。請在物件本身之後使用點符號，並指定在即裝即用節點找到的方法和第一個輸入以外的所有輸入 (因為第一個輸入埠是物件本身，您已經有這個輸入！)
code_block_33 = CodeBlock(pt=origin_4, vector=ZAxis_2) { pt.Add(vector); }
watch_20 = Watch(code_block_33)

# group: 建立清單
# note: 使用方括弧定義清單並使用逗號分隔個別元素，來建立清單
code_block_34 = CodeBlock { ["San Francisco","New York","Chicago"]; }
watch_21 = Watch(code_block_34)
# note: 使用以下表示法從清單中取得項目: list [ i ]，其中 i 是項目的索引。此方法等同於使用 GetItemAtIndex 節點
code_block_35 = CodeBlock(cities=watch_21) { cities[2]; }
watch_22 = Watch(code_block_35)
# note: Multiple variables are defined in this code block, and at the end, a list is created containing all of them.
code_block_36 = CodeBlock()
# ---------- code_block_36.designscript (7 lines) ----------
str0 = "alpha";
str1 = "beta";
str2 = "charlie";
str3 = "delta";
str4 = "echo";
//
[str0,str1,str2,str3,str4];
# ----------------------------------------
watch_23 = Watch(code_block_36.out5)
code_block_37 = CodeBlock(phonetic=watch_23) { phonetic[2..3]; }
watch_24 = Watch(code_block_37)
code_block_38 = CodeBlock { 2; }
getItemAtIndex = List.GetItemAtIndex(list=watch_21, index=code_block_38)
watch_25 = Watch(getItemAtIndex)

# group: 結合清單並存取清單項目
# 描述 <按兩下這裡以編輯群組描述>
# note: 建立巢狀清單，並從巢狀清單中取得項目。
code_block_39 = CodeBlock()
# ---------- code_block_39.designscript (6 lines) ----------
kitchen = ["table","stove","sink","refrigerator"];
livingRoom = ["sofa","books"];
bedroom = ["bed","dirty clothes"];
bathroom = ["tooth brush"];
//
allMyStuff = [kitchen, livingRoom, bedroom, bathroom];
# ----------------------------------------
watch_26 = Watch(code_block_39.allMyStuff)
# note: 存取第三個清單中的第二個項目 (或者換言之，存取索引為「2」的清單中索引為「1」的項目)
code_block_40 = CodeBlock(list=watch_26) { list[2][1]; }
watch_27 = Watch(code_block_40)

# group: 複製
# note: 複製指南可以用來指定清單要以「笛卡兒積」交織。
code_block_41 = CodeBlock { x_vals = 0..10; y_vals = -30..-40; }
code_block_42 = CodeBlock(x_vals=code_block_41.x_vals, y_vals=code_block_41.y_vals) { Point.ByCoordinates(x_vals, y_vals); }
code_block_43 = CodeBlock { x_vals = 0..10; y_vals = -15..-25; }
code_block_44 = CodeBlock(x_vals=code_block_43.x_vals, y_vals=code_block_43.y_vals) { Point.ByCoordinates(x_vals<1>, y_vals<2>); }
byCoordinates_4 = Point.ByCoordinates(x=code_block_41.x_vals, y=code_block_41.y_vals)
byCoordinates_5 = Point.ByCoordinates(x=code_block_43.x_vals, y=code_block_43.y_vals, lacing=CrossProduct)
# note: 使用角括號的複製指南會採用兩個或三個一維集合，並將元素一起配對，以產生一維、二維或三維集合。
# note: 在此範例中，有 2 個 x 值和 5個 y 值。複製指南可以指定產生的組合為 2 個清單 (1 個清單 5 點)，或 5 個清單 (1 個清單 2 點)。
code_block_45 = CodeBlock()
# ---------- code_block_45.designscript (5 lines) ----------
x_vals = 0..1;
y_vals = -3..-7;
//
Point.ByCoordinates(x_vals<1>, y_vals<2>);
Point.ByCoordinates(x_vals<2>, y_vals<1>);
# ----------------------------------------
watch_28 = Watch(code_block_45.out2)
watch_29 = Watch(code_block_45.out3)

# group: 布林
# 比較專門建置的節點與 Code Block
# note: 布林切換節點
boolean = BoolSelector(true)
watch_30 = Watch(boolean)
# note: 在 Code Block 中使用「true」或「false」值，以取得相同結果
code_block_46 = CodeBlock { true; }
watch_31 = Watch(code_block_46)
