# Dynamo graph Core_ListAtLevel.dyn (Dynamo 3.1.0.3411)
# author: Dynamo Team
# 我們探索 List@Level 並瞭解如何使用才能獲得與 List.Map 節點相同的結果。我們建立一系列面板，示範 List@Level 實際的運作方式。

# group: 資訊
# note: 若要判斷您要使用的清單層級，請查看預覽標示圈的底部或觀看節點，然後從 List@Level 標記開始跟著線向上走。

# group: 資訊
# 使用 List@Level 的一般資訊
# note: LIST@LEVEL
# List@Level 取代 List.Map 的功能，可讓您直接選取您要使用的清單層級。
# note: 若要變更您正在使用的清單層級，請按一下清單輸入埠旁邊的箭頭，然後啟用「使用層級」選項。
# 在輸入埠先啟用 List@Level 之後，則會選取第二個最內層 (L2) 的清單來使用。

# group: 資訊
# 此圖表的運作方式
# note: 我們要在格線內部建立面板。若要執行此作業，我們必須取得最內層每個清單位於索引 1 和 2 的點。這可以使用 List@Level 功能輕鬆完成。啟用「保留清單結構」選項可以保留清單的分組。但是首先請先檢查我們使用 Point.ByCoordinates 建立的清單，以判斷我們要使用的清單層級。

# group: 輸入
# 描述 <按兩下這裡以編輯群組描述>
code_block = CodeBlock { 0..30..#8; 12..0..#4; }
# note: 在此範例中，我們將建立一個包含一系列點的 3D 清單。L3 有 8 個清單，每個清單包含另外 4 個清單 (L2)。4 個清單每個又包含 4 個點 (L1)，總共有 128 個點。
byCoordinates = Point.ByCoordinates(x=code_block.out0, y=code_block.out1, z=code_block.out1, lacing=CrossProduct)

# group: 使用 List@Level 取代 List.Map
code_block_2 = CodeBlock { [1,2]; }
# note: 在舊版的 Dynamo 中，List.Map 用於取得清單的內部層級。雖然使用 List.Map 可以獲得相同的結果，但是會將更多節點引入工作區。我們在此處使用 List@Level，以更有效率的方式擷取格線的內部點。我們將使用這些點來建立面板。
# 我們也使用「保留清單結構」選項，維持初始清單的分組，防止結構變平。如果停用「保留清單結構」，則會建立一個 NurbsSurface，而非八個。
getItemAtIndex = List.GetItemAtIndex(list=byCoordinates@@L2, index=code_block_2)
code_block_3 = CodeBlock { [1,2]; }
# note: 清單位於不同層級，L1 為最低層級。此節點產生的元素總數為 64，如右下角所示。
getItemAtIndex_2 = List.GetItemAtIndex(index=code_block_3)  # unwired: list
# note: 以下是等同於套用 List@Level (需要其他節點) 的 List.Map
map = List.Map(f_x=getItemAtIndex_2)  # unwired: list
map_2 = List.Map(list=byCoordinates, f_x=map)

# group: 建立幾何圖形
# note: 使用選取的這些點，我們現在可以建立面板。
byPoints = NurbsSurface.ByPoints(points=getItemAtIndex)
byBestFitThroughPoints = Line.ByBestFitThroughPoints(bestFitPoints=getItemAtIndex)

# group: 檢查有 List@Level 和 Count 的清單
# note: List.Count 節點會傳回每個清單中的元素數目。根據選取的層級，會傳回不同的值。按一下 L3 旁邊的箭頭可變更其值。
# note: L3 有 8 個清單，每個包含 4 個清單。因此，選取 L3 會對 8 個清單實施 List.Count 函數，給出 8 個 '4' 值。
count = List.Count(list=byCoordinates@L3)

# group: 使用「保留清單結構」
# note: 此節點會傳回 L2 每個清單中的元素數目。依預設，結果會展開成 1D 清單。
count_2 = List.Count(list=byCoordinates@L2)
# note: 若要保留清單的巢狀結構，請選取「保留清單結構」選項。「@@」指示如何在 Designscript 中保留清單結構。
count_3 = List.Count(list=byCoordinates@@L2)

# group: 使用 List@Level 和 Flatten 檢查清單
# note: 其他範例包括，您可以使用 List@Level 功能加上 Flatten 節點，輕鬆展開清單內層的巢狀結構。按一下 List@Level 旋轉式控制旁邊的箭頭，可以變更要展開的層級。
# note: 選取 L3 會將該層級的 8 個清單轉換成 1D 陣列。因為 8 個清單每個又包含 4 個項目 (也就是清單)，這會讓 L3 的所有清單展開而產生 16 個點的 8 個清單。
flatten = List.Flatten(list=byCoordinates@L3)
