# Dynamo graph Core_ListLacing.dyn (Dynamo 3.1.0.3411)
# author: Dynamo Team
# 清單交織 - 探索清單交織的所有模式，並以此圖表示範

# group: 資訊
# note: 清單交織
# 交織是 Dynamo 節點用來將不同清單中的項目一起配對的邏輯。Dynamo 中的大多數節點可讓您設定「交織行為」來選擇如何合併資訊清單。
# 在這每一個範例中，會有兩個點清單傳入 Line.ByStartPointEndPoint 節點。產生線的節點必須決定要繪製多少條線，以及在哪一組點之間繪製線。
# 您可以在有兩個或更多輸入埠的節點上按一下右鍵，然後選擇「交織」，來設定交織行為。

# group: 秘訣
# note: 秘訣：為任何製作幾何圖形的節點，將項目索引展示為背景預覽中的標示。 按一下右鍵並選擇「展示標示」。

# group: 秘訣
# note: 秘訣: 節點的交織行為在節點上是以右下角的小圖像來表示。如果您沒有看到任何圖像，則表示節點未交織。

# group: 輸入
# note: 較長系列 (10 個元素)
code_block = CodeBlock { 0..9; }
code_block_2 = CodeBlock { 4; }
# note: 較短系列 (6 個元素)
code_block_3 = CodeBlock { 0..5; }
code_block_4 = CodeBlock { 0..9; }
code_block_5 = CodeBlock { -10; 4; }
code_block_6 = CodeBlock { 0..5; }
code_block_7 = CodeBlock { 0..9; }
code_block_8 = CodeBlock { 10; 4; }
code_block_9 = CodeBlock { 0..5; }

# group: 建立點
# 為 (10 x 6) 建立 2 組點，以用作 Line.ByStartPointEndPoint 的輸入
byCoordinates = Point.ByCoordinates(x=code_block, z=code_block_2)
byCoordinates_2 = Point.ByCoordinates(x=code_block_3)

# group: 最長交織
# note: 最長交織
# 輸入點的較長清單中有多少個項目，就會繪製一樣多的線。當節點用光較短清單中的點時，則會將最後一個項目多產生幾個複本，才能與最長清單中的最後幾個項目配對。
byStartPointEndPoint = Line.ByStartPointEndPoint(startPoint=byCoordinates, endPoint=byCoordinates_2, lacing=Longest)

# group: 建立點
# 為 (10 x 6) 建立 2 組點，以用作 Line.ByStartPointEndPoint 的輸入
byCoordinates_3 = Point.ByCoordinates(x=code_block_4, y=code_block_5.out0, z=code_block_5.out1)
byCoordinates_4 = Point.ByCoordinates(x=code_block_6, y=code_block_5.out0)

# group: 最短交織
# note: 最短交織
# 只繪製和最短輸入清單中的項目數一樣多的線，並捨棄較長清單中「剩餘」的點。
byStartPointEndPoint_2 = Line.ByStartPointEndPoint(startPoint=byCoordinates_3, endPoint=byCoordinates_4)

# group: 建立點
# 為 (10 x 6) 建立 2 組點，以用作 Line.ByStartPointEndPoint 的輸入
byCoordinates_5 = Point.ByCoordinates(x=code_block_7, y=code_block_8.out0, z=code_block_8.out1)
byCoordinates_6 = Point.ByCoordinates(x=code_block_9, y=code_block_8.out0)

# group: 笛卡兒積交織
# note: 笛卡兒積交織
# 產生所有可能的配對組合。如果較長清單中有 10 個點，較短清單中有 6 個點，將會產生 10 x 6 = 60 條線。
byStartPointEndPoint_3 = Line.ByStartPointEndPoint(startPoint=byCoordinates_5, endPoint=byCoordinates_6, lacing=CrossProduct)
# note: 產生的直線將儲存在巢狀清單中 (6 個清單，1 個清單 10 條線，或 10 個清單，1 個清單 6 條線)，視第 1 個指定的清單而定。
watch = Watch(byStartPointEndPoint_3)
