# Dynamo graph Core_Math.dyn (Dynamo 3.4.1.7055)
# author: Dynamo Team
# 廣泛探索 Dynamo 的各種數學函數和功能

# group: 資訊
# note: 數學
# Dynamo 中的數學可以利用 Math 資源庫和 Operators 資源庫中的節點，或利用 Code Block 執行。您可以在下方看到如何利用這三種方法執行幾種基本數學運算。

# group: 基本算術運算子
# note: 算術運算子，例如
# +、-、*、/、%

# group: 基本邏輯運算子
# note: 比較運算子，例如
# <、>、<=、>=、! =、==

# group: 布林運算子
# note: 布林運算子
# (在資源庫中尋找其他運算子。)

# group: 四捨五入
# note: 四捨五入

# group: 複雜的數學函數
# 使用節點、Python、公式獲得相同最終結果的 4 個範例
# note: This example shows four different ways to approach dealing with Math functions.  Each of these examples starts with a grid of points, calculates z-coordinates for the points and then makes a surface.  Only the calculation method differs; these methods all solve the same.
# 1. Nodes. Math nodes are in the Math section of the Library which is further split into Functions, Logic and Operators.
# 2. Python.
# 3. Code Block Node.  Double-click anywhere in the canvas to create a code block node.  Syntax for each function matches the name of the node in Dynamo.
# ** Note: You can adjust the resolution of the geometry preview by navigating to the Render Precision settings: Dynamo -> Preferences -> Visual Settings -> Render Precision
# note: 如需此範例的相關資訊：
# http://dynamobim.org/math-transit/

# group: 弧
# note: 使用 2 種不同方法建立弧，一個使用節點，一個使用 Code Block。為了清楚起見，會視覺化結果

# group: 秘訣
# 亮顯幾何圖形節點
# note: 秘訣: 選取繪製幾何圖形的節點，會將其建立的幾何圖形變成青色。此 Code Block 會繪製圖表的軸、沿著曲線的點，然後曲線本身。選取 Code Block，即可在背景中看到繪製的曲線。

# group: 餘弦曲線
# note: 此組範例示範如何使用節點和 Code Block 繪製餘弦函數。
# 每個範例都採用一系列數字作為一系列點的 X 值，從 X 值計算 Y 值，然後繪製一條餘弦曲線的線。每個圖表最後的大 Code Block 都會將繪製的幾何圖形移至螢幕的不同部分而不會重疊。

# group: 秘訣
# 彩現精確度
# note: Tip: Adjust how precisely the geometry in the background preview is rendered by navigating to Dynamo -> Preferences -> Visual Settings -> Render Precision.  A higher value will make curved surfaces look smoother, but it will take more processing power to draw.

# group: 節點 > 點清單的初始輸入
code_block = CodeBlock { -10..10..#20; }

# group: 節點 > 建立和操作初始點清單
# note: 產生點的格線。
# 請注意，交織行為是
# 「笛卡兒積」。
byCoordinates = Point.ByCoordinates(x=code_block, y=code_block, lacing=CrossProduct)
flatten = List.Flatten(list=byCoordinates)
X = Point.X(point=flatten)
Y = Point.Y(point=flatten)

# group: 節點 > 幅度
# note: 幅度
number_slider = DoubleSlider(5.51, range=0..10 step 0.1)  # graph input

# group: 節點 > 正方形
number = DoubleInput(2)  # graph input
pow = Math.Pow(number=X, power=number)

# group: 節點 > 正方形
number_2 = DoubleInput(2)  # graph input
pow_2 = Math.Pow(number=Y, power=number_2)

# group: 節點 > 頻率
# note: 頻率
number_slider_2 = DoubleSlider(1.724, range=0..6 step 0.1)  # graph input

# group: 節點 > 正方形
number_3 = DoubleInput(2)  # graph input
pow_3 = Math.Pow(number=number_slider_2, power=number_3)

# group: 節點 > 使用節點建立「波紋」幾何圖形的一系列數學計算和操作
add = pow + pow_2
add_2 = add + pow_3
sqrt = Math.Sqrt(number=add_2)
# note: Dynamo 中的角度是以度為單位
radiansToDegrees = Math.RadiansToDegrees(radians=sqrt)
sin = Math.Sin(angle=radiansToDegrees)
div = sin / sqrt
mul = number_slider * div

# group: 節點 > 收集產生的點並準備進行最終彩現
byCoordinates_2 = Point.ByCoordinates(x=X, y=Y, z=mul)
# note: 從初始點集合 (20x20) 計算點群組數
count = List.Count(list=byCoordinates)

# group: 節點 > 點的集合
# note: 依列將展開清單分割為清單系列
chop = List.Chop(list=byCoordinates_2, lengths=count)

# group: 節點 > 曲線網路
# note: 透過點建立 NURBS 曲線
byPoints = NurbsCurve.ByPoints(points=chop)

# group: 節點 > 最終曲面
# note: 建立曲面
byLoft = Surface.ByLoft(crossSections=byPoints)

# group: Code Block > 點清單的初始輸入
code_block_2 = CodeBlock { -10..10..#20; }

# group: Code Block > 建立和操作初始點清單
byCoordinates_3 = Point.ByCoordinates(x=code_block_2, y=code_block_2, lacing=CrossProduct)
flatten_2 = List.Flatten(list=byCoordinates_3)
Y_2 = Point.Y(point=flatten_2)
X_2 = Point.X(point=flatten_2)

# group: Code Block > 移動幾何圖形的輔助工具函數
# note: 移過幾何圖形
code_block_3 = CodeBlock(x=Y_2) { x+60; }

# group: Code Block > 頻率
number_slider_3 = DoubleSlider(1.724, range=0..5 step 0.1)  # graph input

# group: Code Block > 幅度
number_slider_4 = DoubleSlider(5.51, range=0..10 step 0.1)  # graph input

# group: Code Block > 使用 Python 建立「波紋」幾何圖形的一系列數學計算和操作
# note: 數學方法的名稱符合第一個範例中使用的 Dynamo 節點名稱。
code_block_4 = CodeBlock(x=X_2, y=Y_2, c=number_slider_3, A=number_slider_4)
# ---------- code_block_4.designscript (6 lines) ----------
sum = Math.Pow(x,2) + Math.Pow(y,2) + Math.Pow(c,2);

num1 = Math.Sqrt(sum);
num2 = Math.Sin( Math.RadiansToDegrees(num1) );

A * num2 / num1;
# ----------------------------------------

# group: Code Block > 收集產生的點並準備進行最終彩現
byCoordinates_4 = Point.ByCoordinates(x=code_block_3, y=X_2, z=code_block_4.out3)
count_2 = List.Count(list=byCoordinates_3)

# group: Code Block > 點的集合
chop_2 = List.Chop(list=byCoordinates_4, lengths=count_2)

# group: Code Block > 曲線網路
byPoints_2 = NurbsCurve.ByPoints(points=chop_2)

# group: Code Block > 最終曲面
byLoft_2 = Surface.ByLoft(crossSections=byPoints_2)

# group: Python > 點清單的初始輸入
code_block_5 = CodeBlock { -10..10..#20; }

# group: Python > 建立和操作初始點清單
byCoordinates_5 = Point.ByCoordinates(x=code_block_5, y=code_block_5, lacing=CrossProduct)
flatten_3 = List.Flatten(list=byCoordinates_5)
X_3 = Point.X(point=flatten_3)
Y_3 = Point.Y(point=flatten_3)

# group: Python > 移動幾何圖形的輔助工具函數
# note: 移過幾何圖形
code_block_6 = CodeBlock(x=X_3) { x+30; }

# group: Python > 幅度
number_slider_5 = DoubleSlider(5.51, range=0..10 step 0.1)  # graph input

# group: Python > 頻率
number_slider_6 = DoubleSlider(1.724, range=0..5 step 0.1)  # graph input

# group: Python > 使用 Python 建立「波紋」幾何圖形的一系列數學計算和操作
python_script = Python(Amplitude=number_slider_5, X=X_3, Y=Y_3, Frequency=number_slider_6)  # CPython3
# ---------- python_script.python (27 lines) ----------
import clr
clr.AddReference('ProtoGeometry')
from Autodesk.DesignScript.Geometry import *

import math

# The inputs to this node will be stored as a list in the IN variable.
amp = IN[0]   # single value
x = IN[1]     # list
y = IN[2]     # list (expect same length as x)
c = IN[3]     # single value

# Declare an empty array of z-values
z = []

# Solve the equation for each x and y value
for index in range(len(x)):
	sum = math.pow(x[index],2) + math.pow(y[index],2) + math.pow(c,2)
	num1 = math.sqrt(sum)
	num2 = math.sin(num1)
	zVal = amp * num2 / num1
	
	# Append the answer to the list of z values
	z.append(zVal)

# Assign the z-values to the OUT variable
OUT = z
# ----------------------------------------

# group: Python > 收集產生的點並準備進行最終彩現
byCoordinates_6 = Point.ByCoordinates(x=code_block_6, y=Y_3, z=python_script)
count_3 = List.Count(list=byCoordinates_5)

# group: Python > 點的集合
chop_3 = List.Chop(list=byCoordinates_6, lengths=count_3)

# group: Python > 曲線網路
byPoints_3 = NurbsCurve.ByPoints(points=chop_3)

# group: Python > 最終曲面
byLoft_3 = Surface.ByLoft(crossSections=byPoints_3)

# group: 使用 Code Block 的餘弦曲線 > 輸入
# note: 基準座標點
code_block_7 = CodeBlock { 25; 20; }
# note: X 值系列
code_block_8 = CodeBlock { 0..10..#20; }
# note: 幅度
number_slider_7 = DoubleSlider(3, range=0..10 step 0.1)  # graph input
# note: 頻率
number_slider_8 = DoubleSlider(36, range=0..100 step 0.1)  # graph input

# group: 使用 Code Block 的餘弦曲線 > Cos 曲線函數
# 取得給定頻率和角度的餘弦值乘以振幅
code_block_9 = CodeBlock(amplitude=number_slider_7, frequency=number_slider_8, angle=code_block_8) { amplitude * Math.Cos(frequency * angle); }

# group: 使用 Code Block 的餘弦曲線 > 中間運算
byCoordinates_7 = Point.ByCoordinates(x=code_block_7.out0, y=code_block_7.out1)
byCoordinates_8 = Point.ByCoordinates(x=code_block_8, y=code_block_9)

# group: 使用 Code Block 的餘弦曲線 > 建立和視覺化餘弦曲線
code_block_10 = CodeBlock(base=byCoordinates_7, pts=byCoordinates_8)
# ---------- code_block_10.designscript (14 lines) ----------
// Make axes from base point
dimension = 10;
top = Point.ByCoordinates(base.X, base.Y + dimension/2);
bottom = Point.ByCoordinates(base.X, base.Y - dimension/2);
right = Point.ByCoordinates(base.X + 10, base.Y);
Line.ByStartPointEndPoint(bottom, top);
Line.ByStartPointEndPoint(base, right);

// Move function results to base point
vec = base.AsVector();
newPts = pts.Add(vec);

// Draw a line through the points
NurbsCurve.ByPoints(newPts);
# ----------------------------------------

# group: 使用節點的餘弦曲線 > 輸入
# note: 基準點 x,y 座標
code_block_11 = CodeBlock { -5; 20; }
# note: X 值系列
code_block_12 = CodeBlock { 0..10..#20; }
# note: 頻率
number_slider_9 = DoubleSlider(36, range=0..100 step 0.1)  # graph input

# group: 使用節點的餘弦曲線 > 控制振幅
# note: 幅度
number_slider_10 = DoubleSlider(3, range=0..10 step 0.1)  # graph input

# group: 使用節點的餘弦曲線
mul_2 = number_slider_9 * code_block_12

# group: 使用節點的餘弦曲線 > Math.Cos 函數
# 取得每個初始數值的餘弦值
cos = Math.Cos(angle=mul_2)

# group (continued): 使用節點的餘弦曲線
mul_3 = number_slider_10 * cos

# group: 使用節點的餘弦曲線 > 中間運算
byCoordinates_9 = Point.ByCoordinates(x=code_block_11.out0, y=code_block_11.out1)
# note: 秘訣：您可以對任何產生幾何圖形的節點開啟或關閉預覽功能。 按一下右鍵，然後勾選或不勾選「預覽」。
byCoordinates_10 = Point.ByCoordinates(x=code_block_12, y=mul_3)

# group: 使用節點的餘弦曲線 > 建立和視覺化餘弦曲線
code_block_13 = CodeBlock(base=byCoordinates_9, pts=byCoordinates_10)  # same code as code_block_10

# group: 使用節點的弧 > 輸入
# 建立必要輸入:
# 1. 中心點
# 2. 半徑
# 3. 起始角度
# 4. 結束角度
# 5. 法線 (Z 軸)
code_block_14 = CodeBlock { 0; 35; }
byCoordinates_11 = Point.ByCoordinates(x=code_block_14.out0, y=code_block_14.out1)
code_block_15 = CodeBlock { 5; 0; }
# note: 移動滑棒以變更弧的長度。
number_slider_11 = DoubleSlider(247.821, range=0..360 step 0.1)  # graph input
ZAxis = Vector.ZAxis()

# group: 使用節點的弧 > 透過中心點、半徑和角度建立弧
# note: 節點或 Code Block 中的角度是以弳度表示。
byCenterPointRadiusAngle = Arc.ByCenterPointRadiusAngle(center=byCoordinates_11, radius=code_block_15.out0, startAngle=code_block_15.out1, endAngle=number_slider_11, normal=ZAxis)

# group: 使用節點的弧 > 視覺化輸出
endPoint = Curve.EndPoint(curve=byCenterPointRadiusAngle)
byStartPointEndPoint = Line.ByStartPointEndPoint(startPoint=endPoint, endPoint=byCoordinates_11)
startPoint = Curve.StartPoint(curve=byCenterPointRadiusAngle)
byStartPointEndPoint_2 = Line.ByStartPointEndPoint(startPoint=startPoint, endPoint=byCoordinates_11)

# group: 使用節點的運算 > -
code_block_16 = CodeBlock { 5; 2; }
sub = code_block_16.out0 - code_block_16.out1
watch = Watch(sub)

# group: 使用 Code Block 的運算 > -
code_block_17 = CodeBlock { 5-2; }
watch_2 = Watch(code_block_17)

# group: 使用 Code Block 的運算 > %
code_block_18 = CodeBlock { 5%2; }
watch_3 = Watch(code_block_18)

# group: 使用節點的運算 > %
code_block_19 = CodeBlock { 5; 2; }
mod = code_block_19.out0 % code_block_19.out1
watch_4 = Watch(mod)

# group: 使用 Code Block 的運算 > <=
code_block_20 = CodeBlock { 5<=2; }
watch_5 = Watch(code_block_20)

# group: 使用 Code Block 的運算 > >
code_block_21 = CodeBlock { 5>2; }
watch_6 = Watch(code_block_21)

# group: 使用節點的運算 > <=
code_block_22 = CodeBlock { 5; 2; }
le = code_block_22.out0 <= code_block_22.out1
watch_7 = Watch(le)

# group: 使用節點的運算 > >
code_block_23 = CodeBlock { 5; 2; }
gt = code_block_23.out0 > code_block_23.out1
watch_8 = Watch(gt)

# group: 使用 Code Block 的弧 > 輸入
# 建立必要輸入:
# 1. 中心點
# 2. 結束角度
code_block_24 = CodeBlock { 15; 35; }
byCoordinates_12 = Point.ByCoordinates(x=code_block_24.out0, y=code_block_24.out1)
number_slider_12 = DoubleSlider(126.947, range=0..360 step 0.1)  # graph input

# group: 使用 Code Block 的弧 > 透過中心點、半徑和角度建立弧
code_block_25 = CodeBlock(center=byCoordinates_12, endAngle=number_slider_12) { Arc.ByCenterPointRadiusAngle(center,5,0,endAngle,Vector.ZAxis()); }

# group: 使用 Code Block 的弧 > 視覺化輸出
startPoint_2 = Curve.StartPoint(curve=code_block_25)
byStartPointEndPoint_3 = Line.ByStartPointEndPoint(startPoint=startPoint_2, endPoint=byCoordinates_12)
endPoint_2 = Curve.EndPoint(curve=code_block_25)
byStartPointEndPoint_4 = Line.ByStartPointEndPoint(startPoint=endPoint_2, endPoint=byCoordinates_12)

# group: 使用節點的捨入 > 輸入
code_block_26 = CodeBlock { 3.14159; }
code_block_27 = CodeBlock { 3; }

# group: 使用節點的捨入 > 捨去
floor = Math.Floor(number=code_block_26)
watch_9 = Watch(floor)

# group: 使用節點的捨入 > 進位
ceiling = Math.Ceiling(number=code_block_26)
watch_10 = Watch(ceiling)

# group: 使用節點的捨入 > 進位或捨去
# 最接近的值
round = Math.Round(number=code_block_26)
watch_11 = Watch(round)

# group: 使用節點的捨入 > 四捨五入到指定位數
round_2 = Math.Round(number=code_block_26, digits=code_block_27)
watch_12 = Watch(round_2)

# group: 使用 Code Block 的捨入 > 輸入
code_block_28 = CodeBlock { 3.14159; }

# group: 使用 Code Block 的捨入 > 捨去
code_block_29 = CodeBlock(num=code_block_28) { Math.Floor(num); }
watch_13 = Watch(code_block_29)

# group: 使用 Code Block 的捨入 > 進位
code_block_30 = CodeBlock(num=code_block_28) { Math.Ceiling(num); }
watch_14 = Watch(code_block_30)

# group: 使用 Code Block 的捨入 > 進位或捨去
# 最接近的值
code_block_31 = CodeBlock(num=code_block_28) { Math.Round(num); }
watch_15 = Watch(code_block_31)

# group: 使用 Code Block 的捨入 > 四捨五入到指定位數
# 描述 <按兩下這裡以編輯群組描述>
code_block_32 = CodeBlock(num=code_block_28) { Math.Round(num,3); }
watch_16 = Watch(code_block_32)

# group: 使用 Code Block 的運算 > ==(等於)
code_block_33 = CodeBlock { true == false; }
watch_17 = Watch(code_block_33)

# group: 使用 Code Block 的運算 > 非
code_block_34 = CodeBlock { !true; }
watch_18 = Watch(code_block_34)

# group: 使用 Code Block 的運算 > && (且)
code_block_35 = CodeBlock { true && false; }
watch_19 = Watch(code_block_35)

# group: 使用 Code Block 的運算 > || (或)
code_block_36 = CodeBlock { true || false; }
watch_20 = Watch(code_block_36)

# group: 使用節點的運算 > ==(等於)
boolean = BoolSelector(true)  # graph input
boolean_2 = BoolSelector(false)  # graph input
eq = boolean == boolean_2
watch_21 = Watch(eq)

# group: 使用節點的運算 > || (或)
boolean_3 = BoolSelector(true)  # graph input
boolean_4 = BoolSelector(false)  # graph input
or_ = boolean_3 || boolean_4
watch_22 = Watch(or_)

# group: 使用節點的運算 > && (且)
boolean_5 = BoolSelector(true)  # graph input
boolean_6 = BoolSelector(false)  # graph input
and_ = boolean_5 && boolean_6
watch_23 = Watch(and_)

# group: 使用節點的運算 > 非
boolean_7 = BoolSelector(true)  # graph input
not_ = Not(x=boolean_7)
watch_24 = Watch(not_)
