# Dynamo graph Core_PassingFunctions.dyn (Dynamo 3.1.0.3411)
# author: Dynamo Team
# 示範如何在 Dynamo 中傳遞函數

# group: 資訊
# note: 傳送函數
# Dynamo 是功能性語言，這意味著處理動作的方式與處理物件的方式相同。Dynamo 中的大多數節點可以變成函數，並以非常精確的方式用於一組資料上。
# 製作函數和傳送函數如同給出指令「執行 20 分鐘！」，但稍後指定您正在跟誰說話。
# 在此範例中，圓的格線是以複雜結構表示。選取一組圓的指令是直接使用的，然後改為將指令當作函數傳送至較低的資料層級，以取得不同的結果。

# group: 初始輸入
# 建立一個 5x8 的點矩陣
code_block = CodeBlock { 0..#8..4; }
code_block_2 = CodeBlock { 0..#5..4; }
byCoordinates = Point.ByCoordinates(x=code_block, y=code_block_2, lacing=CrossProduct)

# group: 繪製圓的矩陣
# note: 此點清單是以階層結構組織 -- 它是清單中的清單。格線是由 X 方向中的 8 點和 Y 方向中的 5 點構成。此清單代表 8 個清單 (1 個清單 5 個項目)，或點欄的清單。
watch = Watch(byCoordinates)
code_block_3 = CodeBlock { 1.5; }
# note: 繞著每個點繪製圓。
byCenterPointRadius = Circle.ByCenterPointRadius(centerPoint=watch, radius=code_block_3)

# group: 選取第二個和第三個「清單」
# 傳遞函數
code_block_4 = CodeBlock { 1..2; }
# note: 從圓的巢狀清單中，選擇項目 {1,2}。Dynamo 節點永遠都會「從外往內」或從最高層級到最低層級處理清單。
# 從清單中選取項目 1 和 2，將從原始的巢狀清單結構傳回清單 #1 和清單 #2。
getItemAtIndex = List.GetItemAtIndex(list=byCenterPointRadius, index=code_block_4)

# group: 向上擠出
# 產生的圓柱
# note: 選取的資料仍存在於相同的結構中，即在您透過對應來選取它之前的結構。
watch_2 = Watch(getItemAtIndex)
code_block_5 = CodeBlock { 3; }
# note: 這個圓清單會向上擠出。
extrude = Curve.Extrude(curve=watch_2, distance=code_block_5)

# group: 從「每個清單」中選取第二個和第三個「項目」
# 傳遞函數
code_block_6 = CodeBlock { 1..2; }
# note: List@Level 功能允許從 List.GetItemAtIndex 的輸入埠選取 L2，以便在每個清單取得 #1 和 #2 項目，而非從節點的輸出取得頭兩個清單。
# 請注意，此功能可解決 List.Map 的功能，這是用於在 Dynamo 舊版中存取輸入清單的內部層數的方法。
getItemAtIndex_2 = List.GetItemAtIndex(list=byCenterPointRadius@L2, index=code_block_6)

# group: 向下擠出
# 產生的圓柱
watch_3 = Watch(getItemAtIndex_2)
code_block_7 = CodeBlock { -3; }
# note: 這個圓清單會向下擠出。
extrude_2 = Curve.Extrude(curve=watch_3, distance=code_block_7)
