# Dynamo graph Core_Python.dyn (Dynamo 4.1.0.2940)
# author: Dynamo Team
# 在 Dynamo 中使用 Python 節點

# group: 資訊
# note: Python
# Dynamo 透過兩種類型其中一種的 Python 節點支援 CPython (第二種類型的 Python 節點沒有顯示在這裡，可以從外部檔案讀取要執行的指令碼)。
# 按兩下 Python 節點，即可查看其包含的指令碼。
# 輸入包含在 IN 陣列中。輸出必須指定給 OUT 變數。輸出可以是單一值或陣列本身。

# group: 使用 Python 節點對清單套用符號操作
# note: 本範例將加入或減去清單中的所有項目。其輸入為一個數字 (其符號判定使用的是加法還是減法) 和數字清單。

# group: 選擇正數、0 或負數
# 描述 <按兩下這裡以編輯群組描述>
# note: 選擇符號的作業
#     數值 < 0      減去每個
#     數值 = 0       0
#     數值 > 0      加入每個
integer_slider = IntegerSlider(1, range=-1..2 step 1)

# group: 建立輸入清單
# note: 建立任何清單
code_block = CodeBlock { 0..10; }
watch = Watch(code_block)

# group: Python
# 套用符號操作
# note: 來自 OUT 的輸出為陣列，其中第一個項目是單一值，而第二個項目是值的清單。此資料結構已指定在 Python 定義本中。指定陣列可讓您傳送任何數量的輸出至 Dynamo 圖表。
python_script = Python(Sign=integer_slider, List=watch)  # PythonNet3
# ---------- python_script.python (31 lines) ----------
# Python script to find add or subtract a series of numbers. 

# Boiler-plate import statments included out-of-the-box
import clr
clr.AddReference('ProtoGeometry')
from Autodesk.DesignScript.Geometry import *

# The inputs to this node will be stored as a list in the IN variable.
sign = IN[0]  # -1 for subtract all, 0 for do nothing, 1 for add all
nums = IN[1]  # List of numbers to subtract or add

partials = [] # Empty array to contain partial sums or differences
result = 0    # Initialize the sum or difference to 0

# Loop through each item and add it or subtract it from the result.
for index in range(len(nums)):
	if sign > 0:
		result = result + nums[index]
		partials.append(result)
	elif sign == 0:
		partials.append(result)
		continue
	else:
		result = result - nums[index]
		partials.append(result)

# Assign the output to the OUT variable
#OUT = results  # Use this to output only the result.
OUT = []
OUT.append(result)
OUT.append(partials)
# ----------------------------------------

# group: 產生的清單
code_block_2 = CodeBlock { 1; }
getItemAtIndex = List.GetItemAtIndex(list=python_script, index=code_block_2)
# note: 局部結果的系列。
watch_2 = Watch(getItemAtIndex)

# group: 產生的總和
code_block_3 = CodeBlock { 0; }
getItemAtIndex_2 = List.GetItemAtIndex(list=python_script, index=code_block_3)
# note: 總結果。
watch_3 = Watch(getItemAtIndex_2)

# group: 建立 Python 幾何圖形
# note: 此 Python 範例中沒有輸入。它演示如何使用 Dynamo 的照片幾何圖形資源庫來建立幾何圖形。由於 Python 節點會建立可見的幾何圖形，選取它 (正如同任何其他節點一般) 將導致亮顯幾何圖形。
python_script_2 = Python()  # PythonNet3
# ---------- python_script_2.python (24 lines) ----------
import clr
clr.AddReference('ProtoGeometry')
from Autodesk.DesignScript.Geometry import *
#The inputs to this node will be stored as a list in the IN variable.
dataEnteringNode = IN

p1 = Point.ByCoordinates(0, 0, 0);
p2 = Point.ByCoordinates(-10, -10, -10);

l = Line.ByStartPointEndPoint(p1, p2);

pts = [
	Point.ByCoordinates(0, 0, 0),
	Point.ByCoordinates(10, 10, 0),
	Point.ByCoordinates(20, 0, 0),
	Point.ByCoordinates(30, 10, 0),
	Point.ByCoordinates(40, 0, 0) ]
	
spline = NurbsCurve.ByPoints(pts)

surf = spline.Extrude(Vector.ByCoordinates(0, 0, 1), 10)

#Assign your output to the OUT variable
OUT = [l, spline, surf]
# ----------------------------------------

# group: 檢閱產生的結果
# note: 秘訣: 使用 Code Block，
# 可存取清單中的特定項目。
code_block_4 = CodeBlock(output=python_script_2) { output[0]; output[1]; output[2]; }
watch_4 = Watch(code_block_4.out2)
watch_5 = Watch(code_block_4.out0)
watch_6 = Watch(code_block_4.out1)
