# Dynamo graph Core_RangeSyntax.dyn (Dynamo 3.0.0.6964)
# author: Dynamo Team
# 此圖表提供幾種方法產生相等間距的數字或字元序列。

# group: 資訊
# note: 範圍語法
# 有幾種方法可以用數字或字元序列建立清單。
# 在建立元素陣列、迭代，以及為各種函數和方程式做準備時，序列可以派上用場。

# group: 使用 Code Block
# note: start..end..step
# 從 0 到 10，步長為 2
# 此方法相當於使用 Range 節點
code_block = CodeBlock { 0..10..2; }
watch = Watch(code_block)
# note: start..end
# 若未指定步長值，則會假定為 1。
# 此方法等同於使用 Range 節點
# note: 在 Code Block 節點中使用範圍語法。有幾種方法可以產生數字 (或字元) 序列:
#         start..end..step
#         start..end..#amount
#         start..#amount..interval
# start = 序列開始的數字/字元
# end = 序列結束的數字/字元
# step = 兩個連續數字/字元之間的差
# amount = 序列中的數字/字元數量
code_block_2 = CodeBlock { 0..10; }
watch_2 = Watch(code_block_2)
# note: start..end..#amount
# 從 0 到 10，總共 3 步
code_block_3 = CodeBlock { 0..10..#3; }
watch_3 = Watch(code_block_3)
# note: start..#amount..interval
# 從 0 開始，總共 10 步，每一步等於 3
# 此方法相當於使用 Sequence 節點
code_block_4 = CodeBlock { 0..#10..3; }
watch_4 = Watch(code_block_4)

# group: 使用有動態輸入的 Code Block
integer_slider = IntegerSlider(7, range=0..10 step 1)
# note: 以變數取代值，並使用滑棒動態控制清單的長度。
code_block_5 = CodeBlock(howMany=integer_slider) { 0..#howMany..3; }
watch_5 = Watch(code_block_5)

# group: 使用 Sequence
number = DoubleInput(0)
number_slider = DoubleSlider(8, range=0..10 step 0.1)
number_2 = DoubleInput(2)
# note: 如果已知清單中的項目數和每一步的長度，請使用 Sequence 節點。清單中的最後一個結果未預先定義，但可以根據其他輸入計算。
# 範例: 設計 8 個停車格的停車場，已知每個停車格的寬度。所有停車格的總寬度取決於個別寬度和停車格數。
sequence = Sequence(start=number, amount=number_slider, step=number_2, lacing=Longest)
watch_6 = Watch(sequence)

# group: 使用 Range
number_3 = DoubleInput(0)
number_4 = DoubleInput(10)
number_slider_2 = DoubleSlider(1.75, range=0..10 step 0.1)
# note: 如果已知序列的起始和結束，請使用 Range 節點。結果清單中的項目數未預先定義，但可以根據其他輸入計算。
# 請注意，如果 step 值最後因為再增加一步就超出「end」值時，則清單中的最後一個項目可能會與「end」輸入不符。
# 增加「start」和「end」之間的 step 值可能會導致項目變少，反之亦然，減少 step 則會增加清單的長度。
range = Range(start=number_3, end=number_4, step=number_slider_2, lacing=Longest)
watch_7 = Watch(range)

# group: 使用 Range - 具有字串
string = StringInput("A")
string_2 = StringInput("P")
code_block_6 = CodeBlock { 1; }
# note: 您也可以使用 Range 產生字元序列！
range_2 = Range(start=string, end=string_2, step=code_block_6, lacing=Longest)
watch_8 = Watch(range_2)

# group: 使用 Sequence - 具有字串
string_3 = StringInput("A")
code_block_7 = CodeBlock { 20; }
# note: 使用 Sequence 節點，依字母順序產生一系列字母
sequence_2 = Sequence(start=string_3, amount=code_block_7)
watch_9 = Watch(sequence_2)

# note: 使用一系列值建立一系列點
byCoordinates = Point.ByCoordinates(x=code_block_5)
