# Dynamo graph Core_Strings.dyn (Dynamo 3.4.1.7055)
# author: Dynamo Team
# 此圖表示範可對字串執行的動作。

# group: 資訊
# note: 字串
# 此組範例示範一些可使用字串執行的動作。在「String」品類下的 Library 節點中可以找到更多字串作業節點

byCoordinates = Point.ByCoordinates()
code_block = CodeBlock { 5; }
# note: 建立物件 - 圓
byCenterPointRadius = Circle.ByCenterPointRadius(centerPoint=byCoordinates, radius=code_block)

# group: 將物件轉換為字串
# note: 將物件轉換為本身的字串描述。
string_from_object = FromObject(obj=byCenterPointRadius)

watch = Watch(string_from_object)

# group: 使用分隔符號分割字串
code_block_2 = CodeBlock { "("; ")"; " "; "="; ","; }
# note: 指定一個或多個分隔符號字元，將一個字串分為多個部分。每個分隔符號可以是一個或多個字元。
split = String.Split(string=watch, separator0=code_block_2.out0, separator1=code_block_2.out1, separator2=code_block_2.out2, separator3=code_block_2.out3, separator4=code_block_2.out4)

watch_2 = Watch(split)

# group: 檢查字串是否包含子字串
code_block_3 = CodeBlock { "."; }
# note: 尋找字串是否包含另一個字串。
contains = String.Contains(string=watch_2, searchFor=code_block_3)

watch_3 = Watch(contains)

# group: 建立字串
# note: 使用 Code Block 建立字串 - "" 標記分隔字串值。
code_block_4 = CodeBlock { "Few things are harder to put up with than a good example."; }

# group: 變更為全部大寫
string = StringInput(" - Mark Twain")
# note: 變更字串的大小寫
toUpper = String.ToUpper(string=string)
watch_4 = Watch(toUpper)

# group: 連接
# note: 將兩個字串貼附一起，以建立一個稱為 "concatenating" 或簡稱 "concat" 的字串。
concat = String.Concat(string0=code_block_4, string1=watch_4)

watch_5 = Watch(concat)

# group: 取代字串中的字元
code_block_5 = CodeBlock { "put"; }
code_block_6 = CodeBlock { "come"; }
# note: 使用取代字串取代所有出現的子字串。
replace = String.Replace(string=watch_5, searchFor=code_block_5, replaceWith=code_block_6)

watch_6 = Watch(replace)

# group: 在字串中找出子字串
code_block_7 = CodeBlock { " to"; }
# note: 尋找特定子字串在某個字串中出現的位置。結果是子字串開始的索引。
indexOf = String.IndexOf(string=watch_6, searchFor=code_block_7)
watch_7 = Watch(indexOf)

# group: 字串長度
# note: 尋找字串中的字元總數。
length = String.Length(string=watch_6)
watch_8 = Watch(length)

# note: 從字串的總長度減去字串的第一部分
sub = watch_8 - watch_7

# group: 移除字元
# note: 從字串中移除特定數目的字元。
remove = String.Remove(string=watch_6, startIndex=watch_7, count=sub)

# group: 計算出現次數
watch_9 = Watch(remove)
code_block_8 = CodeBlock { "ar"; }
# note: 計算子字串在某個字串內出現的次數。
countOccurrences = String.CountOccurrences(string=watch_9, searchFor=code_block_8)
watch_10 = Watch(countOccurrences)

# group: 建立字串
# note: If the string includes a " character, use an escape character \ before " to treat it as a part of the string and not the end of the string.
code_block_9 = CodeBlock { "There is no \"I\" in Team"; }
watch_11 = Watch(code_block_9)

數字範圍 = CodeBlock { 2..101; }

# group: 使用「Add」連接字串
code_block_10 = CodeBlock { " Dalmatians"; }
# note: 「Add」運算會自動將數字轉換為字串並執行連接
add = 數字範圍 + code_block_10
watch_12 = Watch(add)

# group: 將物件轉換為字串
# note: 在某些情況下，必須先將物件轉換為字串
string_from_object_2 = FromObject(object=數字範圍)
watch_13 = Watch(string_from_object_2)
type = Object.Type(object=string_from_object_2)
watch_14 = Watch(type)

# group: 將字串轉換為數字
code_block_11 = CodeBlock { "101 Dalmatians"; }
code_block_12 = CodeBlock { " "; }
# note: 使用空格作為分隔符號，將字串分割為多個字詞
split_2 = String.Split(string=code_block_11, separator0=code_block_12)
# note: 取得清單中的第一個項目
firstItem = List.FirstItem(list=split_2)
# note: 將字串轉換為數字
toNumber = String.ToNumber(string=firstItem)
watch_15 = Watch(toNumber)
type_2 = Object.Type(object=toNumber)
watch_16 = Watch(type_2)

# group: 將字串轉換為數字
# note: 使用布林清單作為篩選的遮罩，以取得清單中的所有數字
filterByBoolMask = List.FilterByBoolMask(list=watch_2, mask=contains)
# note: 將字串轉換為數字
toNumber_2 = String.ToNumber(string=filterByBoolMask.in)

watch_17 = Watch(filterByBoolMask.in)
