# Dynamo graph Geometry_Curves.dyn (Dynamo 3.1.0.3411)
# author: Dynamo Team
# 這個簡單圖表示範如何建立基本的曲線基本型 - 直線、Polycurve、開放和封閉的 Nurbs 曲線

# group: 資訊
# note: 此圖表示範如何建立基本的曲線基本型 - 直線、Polycurve、開放和封閉的 Nurbs 曲線

# group: 初始輸入
number = DoubleInput(5)
number_2 = DoubleInput(10)
number_3 = DoubleInput(15)

# group: 初始 4 點
byCoordinates = Point.ByCoordinates()
byCoordinates_2 = Point.ByCoordinates(y=number)
byCoordinates_3 = Point.ByCoordinates(x=number_2, y=number_2)
byCoordinates_4 = Point.ByCoordinates(x=number_3)

# group: 4 點清單
create = List.Create(item0=byCoordinates, item1=byCoordinates_2, item2=byCoordinates_3, item3=byCoordinates_4)

# group: Nurbs 曲線
# note: 以 4 點建立 Nurbs 曲線
byPoints = NurbsCurve.ByPoints(points=create)

# group: 線
# note: 以 2 點連成的單一直線
byStartPointEndPoint = Line.ByStartPointEndPoint(startPoint=byCoordinates, endPoint=byCoordinates_2)

length = Curve.Length(curve=byStartPointEndPoint)

# group: Nurbs 曲線 - 封閉
boolean = BoolSelector(true)
# note: 在邊界點內建立封閉的 Nurbs 曲線
byControlPoints = NurbsCurve.ByControlPoints(points=create, closeCurve=boolean)

# group: Polycurve
# 描述 <按兩下這裡以編輯群組描述>
# note: 建立通過一組點的直線 Polycurve
# note: 新註記
byPoints_2 = PolyCurve.ByPoints(points=create)

# group: 動作和查詢
code_block = CodeBlock { 0..1..#20; }
# note: 曲線、Polycurve (曲線集合)、Nurb 和直線全都衍生自「曲線」， 因此可對它們全部執行所有曲線的「動作」和「查詢」
pointAtParameter = Curve.PointAtParameter(curve=byPoints_2, param=code_block)
