# Dynamo graph Geometry_Points.dyn (Dynamo 3.1.0.3411)
# author: Dynamo Team
# 建立點陣列

# group: 初始輸入
number_slider = DoubleSlider(6.4, range=0..10 step 0.1)

# group: 單一點
# note: 基本幾何元素的數值輸入有預設值。請將游標懸停在節點輸入埠上查看預設值
byCoordinates = Point.ByCoordinates(z=number_slider)

# group: 預覽結果
# note: 在按「執行」或啟用「自動執行」後，請在「背景預覽」或 Watch 3D 中查看幾何圖元，或在 Watch 節點中查看資料。選取節點後，元素將在背景中亮顯
watch_3d = Watch3D(byCoordinates)

# group: 初始輸入
number = DoubleInput(0)
number_2 = DoubleInput(10)
number_3 = DoubleInput(1)

# group: 數字範圍
# note: 可以使用順序、範圍和清單，建立幾何圖形的陣列
range = Range(start=number, end=number_2, step=number_3, lacing=Longest)

# group: 點矩陣
# note: 將範圍傳入點的 x、y、z 埠，然後在節點右鍵功能表中變更「交織」性質，來建立 1 維、2 維和 3 維陣列。在選擇「笛卡兒積交織」選項時觀察結果
byCoordinates_2 = Point.ByCoordinates(x=range, y=range, lacing=CrossProduct)

watch = Watch(byCoordinates)

# group: 將點變成向量
# 描述 <按兩下這裡以編輯群組描述>
# note: 某些元素可以輕鬆轉換為其他元素
asVector = Point.AsVector(point=watch)

# group: 透過點移動矩陣成為向量
# note: 可在圖元的動作子品類中使用工具，來建立衍生元素
add = Point.Add(point=byCoordinates_2, vectorToAdd=asVector)

# group: 預覽點「Z」座標
# note: 使用每個節點群組的 Query 子品類 (問號旁邊) 中的節點，可以從 Geometry 中萃取資訊
Z = Point.Z(point=byCoordinates)
