# Dynamo graph Geometry_Solids.dyn (Dynamo 3.1.0.3411)
# author: Dynamo Team
# 此 Dynamo 範例圖表示範使用「斷面混成」建立實體和操控實體 (相加和相減)

# group: 作為第一組曲線的初始點
byCoordinates = Point.ByCoordinates()
number = DoubleInput(10)
byCoordinates_2 = Point.ByCoordinates(x=number)
byCoordinates_3 = Point.ByCoordinates(y=number)

# group: 作為第二組曲線的其他點
number_2 = DoubleInput(5)
byCoordinates_4 = Point.ByCoordinates(z=number_2)

# group: 建立底部基準的初始曲線
byStartPointEndPoint = Line.ByStartPointEndPoint(startPoint=byCoordinates, endPoint=byCoordinates_2)
byThreePoints = Arc.ByThreePoints(firstPoint=byCoordinates, secondPoint=byCoordinates_4, thirdPoint=byCoordinates_2)

# group: 建立底部基準
create = List.Create(item0=byStartPointEndPoint, item1=byThreePoints)
byJoinedCurves = PolyCurve.ByJoinedCurves(curves=create)

# group: 作為第三組曲線的其他點
number_3 = DoubleInput(15)
byCoordinates_5 = Point.ByCoordinates(x=number_3, y=number_3)

# group: 作為第四組曲線的其他點
number_4 = DoubleInput(5)
number_5 = DoubleInput(10)
byCoordinates_6 = Point.ByCoordinates(x=number_4, y=number_5, z=number_5)

# group: 建立頂部基準的初始曲線
byStartPointEndPoint_2 = Line.ByStartPointEndPoint(startPoint=byCoordinates_3, endPoint=byCoordinates_5)
byThreePoints_2 = Arc.ByThreePoints(firstPoint=byCoordinates_3, secondPoint=byCoordinates_6, thirdPoint=byCoordinates_5)

# group: 建立頂部基準
create_2 = List.Create(item0=byStartPointEndPoint_2, item1=byThreePoints_2)
byJoinedCurves_2 = PolyCurve.ByJoinedCurves(curves=create_2)

# group: 將基準曲線合併到清單中
create_3 = List.Create(item0=byJoinedCurves, item1=byJoinedCurves_2)

# group: 斷面混成
# note: 大多數實體存在多個建立方法。這些範例將封閉輪廓展示為基礎，但 polysurface 可以縫合，有許多基本型可用 (表面、立方體、圓錐體等)
byLoft = Solid.ByLoft(crossSections=create_3)

# group: 體積
# note: 您可以查看示範為封閉實體幾何圖形的斷面混成的體積
volume = Solid.Volume(solid=byLoft)

# group: 作為其他斷面混成幾何圖形的其他點
number_6 = DoubleInput(-2)
number_7 = DoubleInput(5)
byCoordinates_7 = Point.ByCoordinates(x=number_6, y=number_7)

# group: 將點合併到清單中
create_4 = List.Create(item0=byCoordinates, item1=byCoordinates_7, item2=byCoordinates_3)

# group: 建立其他基準曲線
# 描述 <按兩下這裡以編輯群組描述>
# note: 這次會從點群組建立一條 Nurbs 曲線
byPoints = NurbsCurve.ByPoints(points=create_4)

# group: 斷面混成 +
# note: 秘訣：關閉節點右鍵功能表中的「預覽」，以從展示中排除元素
byLoft_2 = Solid.ByLoft(crossSections=create_3, guideCurves=byPoints)

# group: 幾何圖形 +
code_block = CodeBlock { Vector.ByCoordinates(-20,0,0); }
# note: 移動幾何圖形以視覺化輸出
translate = Geometry.Translate(geometry=byLoft_2, direction=code_block)

# group: 準備修剪實體幾何圖形的「組成部分」
# note: 厚度
code_block_2 = CodeBlock { 0; }
# note: 秘訣：關閉節點右鍵功能表中的「預覽」，以從展示中排除元素
thinShell = Solid.ThinShell(solid=byLoft, internalFaceThickness=code_block_2)
code_block_3 = CodeBlock { Vector.ByCoordinates(20,0,0); }
# note: 將幾何圖形沿 X 方向移動 20 個單位
translate_2 = Geometry.Translate(geometry=thinShell, direction=code_block_3)
code_block_4 = CodeBlock { Point.ByCoordinates(0,0,5); }
ZAxis = Vector.ZAxis()
# note: 建立要切穿實體的平面
byOriginNormal = Plane.ByOriginNormal(origin=code_block_4, normal=ZAxis)
# note: 此點決定要修剪的實體部分
code_block_5 = CodeBlock { Point.ByCoordinates(10,10,10); }

# group: 斷面混成 -
# note: 幾何布林運算 (交集、差集、聯集等) 均可在幾何圖形品類中使用。
trim = Geometry.Trim(geometry=translate_2, other=byOriginNormal, pick=code_block_5)
