# Dynamo graph Geometry_Surfaces.dyn (Dynamo 3.1.0.3411)
# 此 Dynamo 圖表示範建立曲面的主要方式 - 擠出、斷面混成和掃掠。

# group: 資訊
# note: 此 Dynamo 圖表示範建立曲面的主要方式 - 擠出、斷面混成和掃掠

# group: 輸入
number = DoubleInput(10)
number_2 = DoubleInput(-10)
byCoordinates = Point.ByCoordinates(x=number, y=number_2)
byCoordinates_2 = Point.ByCoordinates(y=number_2)

# group: 線
byStartPointEndPoint = Line.ByStartPointEndPoint(startPoint=byCoordinates, endPoint=byCoordinates_2)

# group: 輸入
byCoordinates_3 = Point.ByCoordinates()

# group: 輸入
number_3 = DoubleInput(5)
byCoordinates_4 = Point.ByCoordinates(z=number_3)

# group: 輸入
number_4 = DoubleInput(10)
byCoordinates_5 = Point.ByCoordinates(x=number_4)
byCoordinates_6 = Point.ByCoordinates(y=number_4)

# group: 弧
byThreePoints = Arc.ByThreePoints(firstPoint=byCoordinates_3, secondPoint=byCoordinates_4, thirdPoint=byCoordinates_5)

# group: 斷面混成
create = List.Create(item0=byStartPointEndPoint, item1=byThreePoints)
# note: 使用 2 組曲線，我們可以在它們之間建立「斷面混成」幾何圖形
byLoft = Surface.ByLoft(crossSections=create)

# group: 演算斷面混成面積
area = Surface.Area(surface=byLoft)
watch = Watch(area)

# group: 輸入
number_5 = DoubleInput(5)
number_6 = DoubleInput(10)
byCoordinates_7 = Point.ByCoordinates(x=number_5, y=number_6, z=number_6)

# group: 輸入
number_7 = DoubleInput(15)
byCoordinates_8 = Point.ByCoordinates(x=number_7, y=number_7)

# group: 弧
byThreePoints_2 = Arc.ByThreePoints(firstPoint=byCoordinates_6, secondPoint=byCoordinates_7, thirdPoint=byCoordinates_8)

# group: 輸入
number_8 = DoubleInput(-5)
number_9 = DoubleInput(5)
byCoordinates_9 = Point.ByCoordinates(x=number_8, y=number_9)

# group: 弧
byThreePoints_3 = Arc.ByThreePoints(firstPoint=byCoordinates_3, secondPoint=byCoordinates_9, thirdPoint=byCoordinates_6)

# group: 掃掠
# note: 大多數曲面存在多個建立方法。  曲面、Polysurface (曲面集合) 和 Nurb 曲面可透過點、曲線建立，並衍生自其他曲面和實體
bySweep2Rails = Surface.BySweep2Rails(path=byThreePoints_2, guideRail=byThreePoints, profile=byThreePoints_3)

# group: 合併斷面混成和掃掠
create_2 = List.Create(item0=byLoft, item1=bySweep2Rails)
# note: 接合為 Polysurface 的曲面可以做為單一圖元來演算
byJoinedSurfaces = PolySurface.ByJoinedSurfaces(surfaces=create_2)

# group: 演算合併的斷面混成 + 掃掠面積
area_2 = Surface.Area(surface=byJoinedSurfaces)
watch_2 = Watch(area_2)

# group: 演算掃掠面積
area_3 = Surface.Area(surface=bySweep2Rails)
watch_3 = Watch(area_3)

# group: 從曲面萃取和使用點
code_block = CodeBlock { 0..1..0.1; }
# note: 可以使用適用於那些幾何圖形的「動作」，從曲面衍生邊、點和其他特徵
pointAtParameter = Surface.PointAtParameter(surface=bySweep2Rails, u=code_block, v=code_block, lacing=CrossProduct)
# note: 透過萃取的參數 (點) 建立新的 Nurbs 曲面。
# 隱藏其餘的幾何圖形以觀察下方幾何圖形的結果。
byControlPoints = NurbsSurface.ByControlPoints(controlVertices=pointAtParameter)
watch_3d = Watch3D(byControlPoints)

# group: 擠出
code_block_2 = CodeBlock { 10; }
# note: 從提供的曲線進行基本的擠出
extrude = Curve.Extrude(curve=byThreePoints_2, distance=code_block_2)
