# Dynamo graph ImportExport_CSV to Stuff.dyn (Dynamo 3.1.0.3411)
# author: Dynamo Team
# 根據剖析的 csv 資料建立幾何圖形

# group: 初始的 helix.csv 輸入
# note: 瀏覽在 x、y 和 z 座標空間具有數字的 CSV 檔
file_path = Filename("..\..\Data\helix.csv")

# group: 讀取檔案
fromPath = FileObject(path=file_path)  # "File.FromPath"
readText = FileSystem.ReadText(file=fromPath)

# group: 剖析 csv 資料
string = StringInput("\n")
# note: 分割回車 <enter> 上的字元
split = String.Split(string=readText, separator0=string)
string_2 = StringInput(",")
# note: 以逗號分割字串
split_2 = String.Split(string=split, separator0=string_2)
# note: CSV 檔提供字串，但不提供數值
toNumber = String.ToNumber(string=split_2)
# note: 群組 X、Y 和 Z 元件
transpose = List.Transpose(lists=toNumber)

# group: 根據從 csv 檔萃取的點，建立「螺旋形」幾何圖形
# note: 「X」座標
firstItem = List.FirstItem(list=transpose)
code_block = CodeBlock { 1; }
# note: 「Y」座標
getItemAtIndex = List.GetItemAtIndex(list=transpose, index=code_block)
# note: 「Z」座標
lastItem = List.LastItem(list=transpose)
byCoordinates = Point.ByCoordinates(x=firstItem, y=getItemAtIndex, z=lastItem)

# group: 放大
number_slider = DoubleSlider(2.337, range=0..20 step 0.1)
# note: 調整座標點的整體分佈
scale = Geometry.Scale(geometry=byCoordinates, amount=number_slider, lacing=Longest)
