# Dynamo graph ImportExport_Excel to Dynamo.dyn (Dynamo 3.1.0.3411)
# author: Dynamo Team
# 此範例圖表示範如何將 Excel 的資料匯入到 Dynamo。

# group: 初始輸入
# note: 瀏覽到 .xlsx Excel 檔案路徑以從中載入資料。
file_path = Filename("..\..\Data\helix.xlsx")
# note: 從檔案路徑取得檔案。
fromPath = FileObject(path=file_path)  # "File.FromPath"
# note: Excel 中包含要匯入資料的工作表名稱。
string = StringInput("helix")

# group: 匯入 Excel 資料
# note: 此節點可以讀取 Excel 工作表的資料。它會讀取所有欄和所有列，在倍精度陣列 [][] (矩陣) 中包含結果資料。
importExcel = Data.ImportExcel(file=fromPath, sheetName=string)

# group: 轉置
# note: 翻轉 (轉置) 清單 (矩陣)。欄會變成列，列會變成欄。
transpose = List.Transpose(lists=importExcel)

# group: 萃取點的座標
number = DoubleInput(0)
# note: X 座標
getItemAtIndex = List.GetItemAtIndex(list=transpose, index=number)
number_2 = DoubleInput(1)
# note: Y 座標
getItemAtIndex_2 = List.GetItemAtIndex(list=transpose, index=number_2)
number_3 = DoubleInput(2)
# note: Z 座標
getItemAtIndex_3 = List.GetItemAtIndex(list=transpose, index=number_3)

# group: 根據從 Excel 萃取的資料建置螺旋線
byCoordinates = Point.ByCoordinates(x=getItemAtIndex, y=getItemAtIndex_2, z=getItemAtIndex_3, lacing=Longest)
