# Dynamo graph OpenXMLExport_Data To Excel.dyn (Dynamo 3.0.3.7594)
# author: Dynamo Team
# 此 Dynamo 範例圖表示範如何將資料匯出至 Excel。

# group: 初始輸入
# note: 驅動點數。請將其視為螺旋線的「高度」。
number_slider = DoubleSlider(1.7, range=0..5 step 0.1)

# group: 建立螺旋線
# note: 建立從 0 開始的一系列數字。增量為 10。點數將乘以 360，因此如果「numCircles」輸入為 1，結果為 37 個數字 (0 到 360)，我們會得到螺旋線的一個完整迴轉。
code_block = CodeBlock(numCircles=number_slider) { 0..(360*numCircles)..10; }
# note: 餘弦函數
cos = Math.Cos(angle=code_block, lacing=Longest)
# note: 正弦函數
sin = Math.Sin(angle=code_block, lacing=Longest)
# note: 除以 100
code_block_2 = CodeBlock(x=code_block) { x/100; }
# note: 建立點清單，X 分量為餘弦，Y 為正弦，Z 為初始值除以 100。
byCoordinates = Point.ByCoordinates(x=cos, y=sin, z=code_block_2, lacing=Longest)
# note: 從點清單建立清單結構 - 結果是包含 3 個清單 ([][] - 雙陣列) 的清單，每個清單分別包含 X、Y、Z 點座標。
code_block_3 = CodeBlock(pt=byCoordinates) { [pt.X,pt.Y,pt.Z]; }

# group: 建立匯出的輸入
# 1. csv 檔的檔案路徑。
# 2. 工作表的名稱。
# 3. 點的已轉置清單。
# 4. Excel 中列和欄的起始索引。
# note: xlsx 檔的檔案路徑。
file_path = Filename("..\..\Data\icosohedron_points.xlsx")
# note: Excel 中的工作表名稱。
string = StringInput("helix")
# note: 翻轉矩陣 (轉置清單)。欄會變成列，列會變成欄。
transpose = List.Transpose(lists=code_block_3)
# note: 在 Excel 中開始記錄資料的欄/列數
number = DoubleInput(0)

# group: 將資料匯出到 Excel 檔案
# note: 將資料匯出到 Excel
openXMLExportExcel = Data.OpenXMLExportExcel(filePath=file_path, sheetName=string, data=transpose, startRow=number, startColumn=number)
