# Dynamo graph OpenXMLImport_Data From Excel.dyn (Dynamo 3.1.0.3411)
# author: Dynamo Team
# 此範例圖表示範如何匯入 Excel 檔案的資料。

# group: 初始輸入
# 1. Excel 檔案的檔案路徑。
# 2. 工作表的名稱
file_path = Filename("..\..\Data\helix.xlsx")
string = StringInput("helix")

# group: 萃取 Excel 的資料
# note: 讀取 Excel 的資料
openXMLImportExcel = Data.OpenXMLImportExcel(filePath=file_path, sheetName=string)

# group: 剖析 Excel 的資料
# 「剖析」資料是一種操控資料來源，使其在使用前成為環境原生資料的過程。
# note: 轉置清單 (翻轉矩陣)。欄會變成列，列會變成欄。
transpose = List.Transpose(lists=openXMLImportExcel)
# note: 第一個清單
number = DoubleInput(0)
# note: 第二個清單
number_2 = DoubleInput(1)
# note: 第三個清單
number_3 = DoubleInput(2)

# group: 建立螺旋線
# note: X 座標
getItemAtIndex = List.GetItemAtIndex(list=transpose, index=number)
# note: Y 座標
getItemAtIndex_2 = List.GetItemAtIndex(list=transpose, index=number_2)
# note: Z 座標
getItemAtIndex_3 = List.GetItemAtIndex(list=transpose, index=number_3)
byCoordinates = Point.ByCoordinates(x=getItemAtIndex, y=getItemAtIndex_2, z=getItemAtIndex_3, lacing=Longest)
