# Dynamo graph create point.dyn (Dynamo 0.7.0.21043)

code_block = CodeBlock { 0; }
byCoordinates = Point.ByCoordinates(code_block, code_block, code_block, lacing=Longest)
byPoint = ReferencePoint.ByPoint(byCoordinates, lacing=Longest)
