# Dynamo graph create point_sequence.dyn (Dynamo 0.7.0.21043)

code_block = CodeBlock { 0; }
number_slider = DoubleSlider(80, range=0..100)
code_block_2 = CodeBlock(x=number_slider) { 0..x..10; }
byCoordinates = Point.ByCoordinates(code_block, code_block, code_block_2, lacing=Longest)
byPoint = ReferencePoint.ByPoint(byCoordinates, lacing=Longest)
# note: New way of Defining Number Range
code_block_3 = CodeBlock { 0..80..10; }
watch = Watch(code_block_3)
