# Dynamo graph ref grid sliders - end.dyn (Dynamo 0.7.0.21043)

family_types = FamilyTypes(index=4)
# note: Distnace in X direction
number_slider = DoubleSlider(30, range=0..50)
# note: Number of points along X and Y
number_slider_2 = DoubleSlider(5.955, range=0..10)
# note: Distnace in Y direction
number_slider_3 = DoubleSlider(19, range=0..50)
code_block = CodeBlock(x=number_slider, pt1=number_slider_2, y=number_slider_3, pt2=number_slider_2) { 0..x..#pt1; 0..y..#pt2; 0; }
# note: Point Grid
byCoordinates = Point.ByCoordinates(code_block.out0, code_block.out1, code_block.out2, lacing=CrossProduct)
# note: Plance Families in Revit based on Point Grid
byPoint = FamilyInstance.ByPoint(family_types, byCoordinates, lacing=Longest)
