# Dynamo graph divide selected curve - end.dyn (Dynamo 0.7.0.18969)

# note: Select curve from Revit
select_model_element = DSModelElementSelection()
# note: Converting Revit curve to Curve Geometry
curve = CurveElement.Curve(select_model_element)
number_slider = DoubleSlider(33.333, range=0..100)
# note: Parameter should be 0 to 1 and 'x' is for defining number of Points on Curve
code_block = CodeBlock(x=number_slider) { 0..1..#x; }
pointAtParameter = Curve.PointAtParameter(curve, code_block)
byPoint = ReferencePoint.ByPoint(pointAtParameter, lacing=Longest)
