# Dynamo graph divide selected curve.dyn (Dynamo 0.7.0.18969)

# note: Select curve from Revit
select_model_element = DSModelElementSelection()
# note: Converting Revit curve to Curve Geometry.
curve = CurveElement.Curve(select_model_element)
# note: Parameter should be 0 to 1 and '#10' defines number of Points on Curve
code_block = CodeBlock { 0..1..#10; }
pointAtParameter = Curve.PointAtParameter(curve, code_block)
byPoint = ReferencePoint.ByPoint(pointAtParameter, lacing=Longest)
