# Dynamo graph form from curve selection.dyn (Dynamo 0.7.0.21043)

# note: Select curve from Revit
select_model_element = DSModelElementSelection()
select_model_element_2 = DSModelElementSelection()
create_list = List.Create(select_model_element, select_model_element_2)
boolean = BoolSelector(false)
byLoftingCurveElements = Form.ByLoftingCurveElements(create_list, boolean)
