# Dynamo graph graph function and connect points.dyn (Dynamo 0.7.0.21043)

code_block = CodeBlock { -1; }
PI = Math.PI()
mul = code_block * PI  # lacing=Longest
code_block_2 = CodeBlock { 32; }
code_block_3 = CodeBlock(start=mul, end=PI, amount=code_block_2) { start..end..#amount; }
code_block_4 = CodeBlock(x=code_block_3) { Math.Sin(x); 0; }
byCoordinates = Point.ByCoordinates(code_block_3, code_block_4.out0, code_block_4.out1, lacing=Longest)
byPoint = ReferencePoint.ByPoint(byCoordinates, lacing=Longest)
byPoints = NurbsCurve.ByPoints(byCoordinates)
byCurve = ModelCurve.ByCurve(byPoints, lacing=Longest)
