# Dynamo graph Connect Two Point Arrays.dyn (Dynamo 0.7.0.23736)

select_model_element = DSModelElementSelection()  # 1 picked in the model
curve = CurveElement.Curve(select_model_element)
integer_slider = IntegerSlider(4, range=0..20)
code_block = CodeBlock(x=integer_slider) { 0..1..#x; }
pointAtParameter = Curve.PointAtParameter(curve, code_block, lacing=Longest)
select_model_element_2 = DSModelElementSelection()  # 1 picked in the model
curve_2 = CurveElement.Curve(select_model_element_2)
pointAtParameter_2 = Curve.PointAtParameter(curve_2, code_block, lacing=Longest)
python_script = Python(IN[0]=pointAtParameter, IN[1]=pointAtParameter_2)
# ---------- python_script.python (16 lines) ----------
import clr
clr.AddReference("RevitNodes")
clr.AddReference('ProtoGeometry')
from Revit.Elements import *
from Autodesk.DesignScript.Geometry import *

leftPts = IN[0]
rightPts = IN[1]

lines = []
for left, right in zip(leftPts, rightPts):
	line = Line.ByStartPointEndPoint(left, right)
	crv = ModelCurve.ByCurve(line)
	lines.append(crv)

OUT = lines
# ----------------------------------------
watch = Watch(python_script)
