# Dynamo graph Sine Wave From Selected Curve.dyn (Dynamo 0.7.0.23736)

select_model_element = DSModelElementSelection()  # 1 picked in the model
python_script = Python(IN[0]=select_model_element)
# ---------- python_script.python (38 lines) ----------
#derived from Nathan Miller's example http://theprovingground.wikidot.com/revit-api-py-curves

# Default imports
import clr
clr.AddReference('RevitAPI')
clr.AddReference('RevitAPIUI')
clr.AddReference('RevitServices')
clr.AddReference("RevitNodes")
import Revit
clr.ImportExtensions(Revit.Elements)
import Autodesk
from Autodesk.Revit.DB import *
from RevitServices import *
import math

doc = Persistence.DocumentManager.Instance.CurrentDBDocument

crv = IN[0]
crvRef = crv.InternalElement.GeometryCurve
refptarr = ReferencePointArray()

Transactions.TransactionManager.Instance.EnsureInTransaction(doc)

#use for loop to create a series of points
steps = 20
for i in range(0,steps+1):
    pt = crvRef.Evaluate(float(i)/steps,1) # returns and XYZ
    x = pt.X
    y = pt.Y
    z = pt.Z + math.sin(i)*steps 
    myXYZ = XYZ(x,y,z)
    refPt = doc.FamilyCreate.NewReferencePoint(myXYZ)
    refptarr.Append(refPt)
crv2 = doc.FamilyCreate.NewCurveByPoints(refptarr)

Transactions.TransactionManager.Instance.TransactionTaskDone()

OUT = crv2.ToDSType(False)
# ----------------------------------------
