# Dynamo graph read python from file.dyn (Dynamo 0.7.0.21043)

filename = Filename("C:\Autodesk\DynamoDS\Core\samples\09 Dynamic Python Editing\dynamo python.py")
readText = File.FileReader.ReadText(filename)
number_slider = DoubleSlider(9.333, range=-10..10)
python_script_from_string = PythonStringNode(script=readText, IN[0]=number_slider)
watch = Watch(python_script_from_string)
watch_2 = Watch(readText)
