# Dynamo graph Attractor Logic_End.dyn (Dynamo 0.7.0.21043)

code_block = CodeBlock { x = 0..30..#15; 0; }
# note: XYZ Point Grid
byCoordinates = Point.ByCoordinates(code_block.x, code_block.x, code_block.out1, lacing=CrossProduct)
number_slider = DoubleSlider(16.567, range=0..30)
number_slider_2 = DoubleSlider(20.373, range=0..30)
code_block_2 = CodeBlock { 0; }
# note: 'Attractor' Point
byCoordinates_2 = Point.ByCoordinates(number_slider, number_slider_2, code_block_2, lacing=Longest)
# note: Create a distance-based
# relationship with a single point.
distanceTo = Geometry.DistanceTo(byCoordinates, byCoordinates_2)
code_block_3 = CodeBlock { 30; }
div = distanceTo / code_block_3
# note: Circle with variable radii
byCenterPointRadius = Circle.ByCenterPointRadius(byCoordinates, div, lacing=Longest)
watch_3d = Watch3D(byCenterPointRadius)
# note: Make Revit Stuff
referenceCurveByCurve = ModelCurve.ReferenceCurveByCurve(byCenterPointRadius)
