# Dynamo graph Indexed Family Instances.dyn (Dynamo 0.7.0.21043)

family_types = FamilyTypes(index=4)
code_block = CodeBlock { 1; }
number_slider = DoubleSlider(20, range=0..20)
code_block_2 = CodeBlock { 1; }
code_block_3 = CodeBlock(start0=code_block, end1=number_slider, step2=code_block_2) { start0..end1..step2; }
count = List.Count(code_block_3)
code_block_4 = CodeBlock(x=count) { 0..10..#x; }
code_block_5 = CodeBlock { 0; }
byCoordinates = Point.ByCoordinates(code_block_4, code_block_5, code_block_5)
byPoint = FamilyInstance.ByPoint(family_types, byCoordinates, lacing=Longest)
