# Dynamo graph Arc and Line.dyn (Dynamo 0.7.0.19118)

# note: Select Points from Revit for each "Select Model Element" node.
select_model_element = DSModelElementSelection()  # 1 picked in the model
point = ReferencePoint.Point(select_model_element, lacing=Longest)
select_model_element_2 = DSModelElementSelection()  # 1 picked in the model
point_2 = ReferencePoint.Point(select_model_element_2, lacing=Longest)
select_model_element_3 = DSModelElementSelection()  # 1 picked in the model
point_3 = ReferencePoint.Point(select_model_element_3, lacing=Longest)
byThreePoints = Arc.ByThreePoints(point, point_2, point_3, lacing=Longest)
byCurve = ModelCurve.ByCurve(byThreePoints, lacing=Longest)
byStartPointEndPoint = Line.ByStartPointEndPoint(point, point_3, lacing=Longest)
create_list = List.Create(byThreePoints, byStartPointEndPoint)
watch_3d = Watch3D(create_list)
byCurve_2 = ModelCurve.ByCurve(byStartPointEndPoint, lacing=Longest)
