# Dynamo graph Arc.dyn (Dynamo 0.7.0.21043)

# note: Select three points
select_model_element = DSModelElementSelection()  # 1 picked in the model
point = ReferencePoint.Point(select_model_element, lacing=Longest)
select_model_element_2 = DSModelElementSelection()  # 1 picked in the model
point_2 = ReferencePoint.Point(select_model_element_2, lacing=Longest)
select_model_element_3 = DSModelElementSelection()  # 1 picked in the model
point_3 = ReferencePoint.Point(select_model_element_3, lacing=Longest)
byThreePoints = Arc.ByThreePoints(point, point_2, point_3, lacing=Longest)
byCurve = ModelCurve.ByCurve(byThreePoints)
watch = Watch(byCurve)
watch_3d = Watch3D(byThreePoints)
