# Dynamo graph Excel to Stuff.dyn (Dynamo 0.7.0.29588)

getWorksheetsFromExcelWorkbook = Excel.GetWorksheetsFromExcelWorkbook()
writeDataToExcelWorksheet = Excel.WriteDataToExcelWorksheet()
addExcelWorksheetToWorkbook = Excel.AddExcelWorksheetToWorkbook()
newExcelWorkbook = Excel.NewExcelWorkbook()
saveAsExcelWorkbook = Excel.SaveAsExcelWorkbook()
file_path = Filename("C:\Autodesk\Dynamo07\Core\samples\10 Spreadsheets\helix.xlsx")
readExcelFile = Excel.ReadExcelFile(file_path)
code_block = CodeBlock { "helix"; }
getExcelWorksheetByName = Excel.GetExcelWorksheetByName(readExcelFile, code_block)
getDataFromExcelWorksheet = Excel.GetDataFromExcelWorksheet(getExcelWorksheetByName)
watch = Watch(getDataFromExcelWorksheet)
transpose = Transpose(getDataFromExcelWorksheet)
watch_2 = Watch(transpose)
code_block_2 = CodeBlock { 0; }
getItemAtIndex = List.GetItemAtIndex(transpose, code_block_2)
code_block_3 = CodeBlock { 1; }
getItemAtIndex_2 = List.GetItemAtIndex(transpose, code_block_3)
code_block_4 = CodeBlock { 2; }
getItemAtIndex_3 = List.GetItemAtIndex(transpose, code_block_4)
byCoordinates = Point.ByCoordinates(getItemAtIndex, getItemAtIndex_2, getItemAtIndex_3, lacing=Longest)
watch_3d = Watch3D(byCoordinates)
watch_3 = Watch(getItemAtIndex)
