# Dynamo graph Translate and Rotate sequence.dyn (Dynamo 0.7.0.21043)

code_block = CodeBlock { 0; }
byCoordinates = Point.ByCoordinates(code_block, code_block, code_block, lacing=Longest)
identity = CoordinateSystem.Identity()
ZAxis = Vector.ZAxis(lacing=Longest)
code_block_2 = CodeBlock { 0.1; }
number_slider = DoubleSlider(6.24, range=0..6.24)
code_block_3 = CodeBlock { 0.25; }
code_block_4 = CodeBlock(start0=code_block_2, end1=number_slider, step2=code_block_3) { start0..end1..step2; }
radiansToDegrees = Math.RadiansToDegrees(code_block_4)
rotate = CoordinateSystem.Rotate(identity, byCoordinates, ZAxis, radiansToDegrees)
XAxis = CoordinateSystem.XAxis(rotate)
translate = Geometry.Translate(byCoordinates, XAxis, code_block_4)
byStartPointEndPoint = Line.ByStartPointEndPoint(byCoordinates, translate, lacing=Longest)
watch_3d = Watch3D(byStartPointEndPoint)
watch = Watch(code_block_4)
XAxis_2 = Vector.XAxis(lacing=Longest)
scale = Vector.Scale(XAxis_2, code_block_4, lacing=Longest)
translate_2 = Geometry.Translate(byCoordinates, scale, code_block_4)
