# Dynamo graph Translate and Rotate.dyn (Dynamo 0.7.0.21043)

code_block = CodeBlock { 0; }
byCoordinates = Point.ByCoordinates(code_block, code_block, code_block, lacing=Longest)
identity = CoordinateSystem.Identity()
ZAxis = Vector.ZAxis(lacing=Longest)
number_slider = DoubleSlider(1.004, range=0..6.24)
radiansToDegrees = Math.RadiansToDegrees(number_slider)
rotate = CoordinateSystem.Rotate(identity, byCoordinates, ZAxis, radiansToDegrees, lacing=Longest)
XAxis = CoordinateSystem.XAxis(rotate)
number_slider_2 = DoubleSlider(5.879, range=0..10)
scale = Vector.Scale(XAxis, number_slider_2, lacing=Longest)
translate = Geometry.Translate(byCoordinates, scale, lacing=Longest)
byStartPointEndPoint = Line.ByStartPointEndPoint(byCoordinates, translate, lacing=Longest)
watch_3d = Watch3D(byStartPointEndPoint)
