# Dynamo graph Adaptive Component Placement.dyn (Dynamo 0.7.0.21043)

# note: Select curve from Revit
select_model_element = DSModelElementSelection()
select_model_element_2 = DSModelElementSelection()
select_model_element_3 = DSModelElementSelection()
create_list = List.Create(select_model_element, select_model_element_2, select_model_element_3)
# note: Run this graph by opening "Adaptive Component Placement.rfa" from Samples folder.
curve = CurveElement.Curve(create_list)
integer_slider = IntegerSlider(5, range=2..10)
code_block = CodeBlock(x=integer_slider) { 0..1..#x; }
pointAtParameter = Curve.PointAtParameter(curve, code_block, lacing=CrossProduct)
transpose = Transpose(pointAtParameter)
family_types = FamilyTypes(index=0)
byPoints = AdaptiveComponent.ByPoints(transpose, family_types)
