# Dynamo graph FormulaCurve.dyn (Dynamo 0.7.0.21043)

code_block = CodeBlock { 0; }
number_slider = DoubleSlider(6.283, range=0..6.283)
code_block_2 = CodeBlock { 0.2; }
code_block_3 = CodeBlock(start0=code_block, end1=number_slider, step2=code_block_2) { start0..end1..step2; }
radiansToDegrees = Math.RadiansToDegrees(code_block_3)
code_block_4 = CodeBlock(x=radiansToDegrees) { Math.Sin(x); }
number = DoubleInput(2)
pow = Math.Pow(code_block_4, number)
number_slider_2 = DoubleSlider(0.746, range=0..1)
mul = code_block_3 * number_slider_2  # lacing=Longest
code_block_5 = CodeBlock(a=radiansToDegrees, b=mul) { Math.Cos(a)+Math.Sin(b); }
byCoordinates = Point.ByCoordinates(code_block_4, pow, code_block_5)
number_slider_3 = DoubleSlider(34.444, range=0..40)
scale = Geometry.Scale(byCoordinates, number_slider_3)
byPoints = NurbsCurve.ByPoints(scale, lacing=Longest)
watch_3d = Watch3D(byPoints)
# note: Make Revit Stuff
referenceCurveByCurve = ModelCurve.ReferenceCurveByCurve(byPoints)
radiansToDegrees_2 = Math.RadiansToDegrees(mul)
