# Dynamo graph BasicListManagement.dyn (Dynamo 0.7.0.21043)

code_block = CodeBlock { 0; }
number_slider = DoubleSlider(4.004, range=0..20)
code_block_2 = CodeBlock { 1; }
# note: Creates a list of numbers
code_block_3 = CodeBlock(start3=code_block, end4=number_slider, step5=code_block_2) { start3..end4..step5; }
# note: Watch:  Shows Data Sequence
watch = Watch(code_block_3)
number = DoubleInput(0)
# note: List of Numbers drives
# X Coordinate value
byCoordinates = Point.ByCoordinates(code_block_3, number, number, lacing=Longest)
code_block_4 = CodeBlock { 0; }
number_slider_2 = DoubleSlider(6.499, range=0..15)
code_block_5 = CodeBlock { 1; }
# note: Creates a second sequence of numbers
code_block_6 = CodeBlock(start0=code_block_4, end1=number_slider_2, step2=code_block_5) { start0..end1..step2; }
code_block_7 = CodeBlock { 4; }
byCoordinates_2 = Point.ByCoordinates(code_block_6, code_block_7, number, lacing=Longest)
# note: Lines connected by 2 sequences
# of XYZ coordinates
byStartPointEndPoint = Line.ByStartPointEndPoint(byCoordinates, byCoordinates_2, lacing=Longest)
# note: Watch 3D showing viewport with preview geometry
watch_3d = Watch3D(byStartPointEndPoint)
code_block_8 = CodeBlock { 0; }
number_slider_3 = DoubleSlider(6.499, range=0..15)
code_block_9 = CodeBlock { 1; }
code_block_10 = CodeBlock(start6=code_block_8, end7=number_slider_3, step8=code_block_9) { start6..end7..step8; }
number_2 = DoubleInput(0)
# note: A sequence controls X and Y.
# Lacing set to 'Cross Product'
byCoordinates_3 = Point.ByCoordinates(code_block_10, code_block_10, number_2, lacing=CrossProduct)
# note: A grid of points.
watch_3d_2 = Watch3D(byCoordinates_3)
code_block_11 = CodeBlock { 3; }
# note: Get a single Item From list
getItemAtIndex = List.GetItemAtIndex(byCoordinates_3, code_block_11)
watch_2 = Watch(getItemAtIndex)
integer_slider = IntegerSlider(3, range=0..10)
# note: Take a number of items from the list
takeItems = List.TakeItems(byCoordinates_3, integer_slider)
watch_3 = Watch(takeItems)
watch_4 = Watch(byCoordinates)
