# Dynamo graph Creation.dyn (Dynamo 0.7.0.24448)

code_block = CodeBlock { 1..5; 2; }
cycle = List.Cycle(code_block.out0, code_block.out1)
watch = Watch(cycle)
code_block_2 = CodeBlock { 5; }
# note: Repeating existing data to create new lists.
ofRepeatedItem = List.OfRepeatedItem(code_block_2, code_block_2)
watch_2 = Watch(ofRepeatedItem)
code_block_3 = CodeBlock { {1,2,3,4,5}; }
watch_3 = Watch(code_block_3)
# note: Creating a list using a Code Block or the List.Create node.
code_block_4 = CodeBlock { 1; 2; 3; 4; 5; }
create = List.Create(code_block_4.out0, code_block_4.out1, code_block_4.out2, code_block_4.out3, code_block_4.out4)
# note: Notice all outputs are the same.
watch_4 = Watch(create)
code_block_5 = CodeBlock { 1..5; }
watch_5 = Watch(code_block_5)
code_block_6 = CodeBlock { 4..8; 0..3; 9..14; }
# note: List.Join will create a single list out of multiple lists.
join = List.Join(code_block_6.out0, code_block_6.out1, code_block_6.out2)
watch_6 = Watch(join)
code_block_7 = CodeBlock { 0..10; 3; }
# note: List.ShiftIndices will move all items in the list over to the right by the given amount. Items that fall off the end are placed at the beginning.
shiftIndices = List.ShiftIndices(code_block_7.out0, code_block_7.out1)
watch_7 = Watch(shiftIndices)
code_block_8 = CodeBlock { -3; }
shiftIndices_2 = List.ShiftIndices(code_block_7.out0, code_block_8)
watch_8 = Watch(shiftIndices_2)
code_block_9 = CodeBlock { 0..10; }
# note: Supplying a negative amount will cause all items in the list to move to the left, rather than the right.
# note: Lists can be reversed.
reverse = List.Reverse(code_block_9)
watch_9 = Watch(reverse)
# note: And can be queried for the number of items they contain.
count = List.Count(code_block_9)
watch_10 = Watch(count)
code_block_10 = CodeBlock { {1,1,2,3,4,5,5,6,7,8,8,8,9,10}; }
# note: Stripping all duplicates from a list.
uniqueItems = List.UniqueItems(code_block_10)
watch_11 = Watch(uniqueItems)
