# Dynamo graph Filtering.dyn (Dynamo 0.7.0.22032)

code_block = CodeBlock { 0..10; }
formula = Formula("n%2==1")
# note: List.Filter takes in a list to be filtered, and a condition used to determine if a single item from the list passes the filter.
# note: The "condition" is represented as a Function. Internally, every item in the list is passed to the condition function. If the condition returns true, the item is stored in the "in" result. If the condition returns false, the item is stored in the "out" result.
filter = List.Filter(code_block, formula)
odds = Watch(filter.out0)
evens = Watch(filter.out1)
code_block_2 = CodeBlock { 0..10; }
# note: This formula checks if its input is odd.
byCoordinates = Point.ByCoordinates(code_block_2)
code_block_3 = CodeBlock(l=code_block_2) { 0..(Count(l) - 1); }
formula_2 = Formula("n%2==1", n=code_block_3)
# note: List.FilterByBooleanMask takes in a separate list of booleans, called a mask.
# note: For every item in the list to be filtered, an corresponding boolean is taken from the mask at the same index. If the boolean is true, the item is stored in the "in" result. If the boolean is false, the item is stored in the "out" result.
filterByBoolMask = List.FilterByBoolMask(byCoordinates, formula_2)
watch = Watch(filterByBoolMask.out1)
watch_2 = Watch(filterByBoolMask.out0)
code_block_4 = CodeBlock { 0..10; }
# note: Plus it requires an extra connector, so much more work!
formula_3 = Formula("n%2==1", n=code_block_4)
# note: Filtering by a mask is particularly useful if you want to filter a list based on the content of another list.
# note: Note that you can recreate List.Filter using List.FilterByBoolMask. This is inefficient compared to just using List.Filter. This is because List.Filter does not need to create a list of booleans in memory, whereas List.FilterByBoolMask does (the mask input).
filterByBoolMask_2 = List.FilterByBoolMask(code_block_4, formula_3)
watch_3 = Watch(filterByBoolMask_2.out1)
watch_4 = Watch(filterByBoolMask_2.out0)
code_block_5 = CodeBlock { { 1, 2, null, 4, 5, null, null, 8, 9 }; }
code_block_6 = CodeBlock { 0; }
# note: Here, all nulls are replaced with 0.
isNull = Object.IsNull()
# note: For situations where you don't want to remove items but instead replace them, you can use the ReplaceByCondition node.
# note: Again, the condition input is a function used to test each item. If condition returns true, the item is replaced. If condition returns false, the item is kept.
replaceByCondition = Replace(code_block_5, code_block_6, isNull)
watch_5 = Watch(replaceByCondition)
