# Dynamo graph Lacing.dyn (Dynamo 0.7.0.25080)

# note: Nodes that normally accept single values can also accept lists of values. This concept is called lacing.
code_block = CodeBlock { 0..10; 0..5; }
byCoordinates = Point.ByCoordinates(code_block.out0, code_block.out1)
watch = Watch(byCoordinates)
# note: Shortest Lacing:
# Items in each list are associated by index, once a list runs out of items then the lacing stops.
byCoordinates_2 = Point.ByCoordinates(code_block.out0, code_block.out1, lacing=Longest)
watch_2 = Watch(byCoordinates_2)
# note: Longest Lacing:
# Items in each list are associated by index, once a list runs out of items the last item is repeated. Lacing stops once the longest list runs out of items.
# note: Cross Product:
# Every item in a list is associated with every item in each other list. Lacing stops when all combinations are exhausted.
# note: You can change the lacing strategy of a node from the node's context menu (right-click).
byCoordinates_3 = Point.ByCoordinates(code_block.out0, code_block.out1, lacing=CrossProduct)
watch_3 = Watch(byCoordinates_3)
code_block_2 = CodeBlock { 0..10; 0..5; }
# note: For Cross Product, the indexes for the replication guides must not match.
code_block_3 = CodeBlock(x=code_block_2.out0, y=code_block_2.out1) { Point.ByCoordinates(x<1>, y<2>, 0); }
watch_4 = Watch(code_block_3)
# note: To explicitly declare Shortest Lacing, append Replication Guides (<#>) with the same index to the list arguments.
# By using the same index, Dynamo knows that both lists need to be iterated (laced) at the same time.
# note: For Longest Lacing, add an "L" after the index in the replication guide.
code_block_4 = CodeBlock(code_block_2.out0, code_block_2.out1) { Point.ByCoordinates(x<1L>, y<1L>, 0); }
watch_5 = Watch(code_block_4)
# note: Lacing is also performed when using lists in a Code Block node. By default, Shortest Lacing is used.
code_block_5 = CodeBlock(x=code_block_2.out0, y=code_block_2.out1) { Point.ByCoordinates(x, y, 0); }
watch_6 = Watch(code_block_5)
code_block_6 = CodeBlock(x=code_block_2.out0, y=code_block_2.out1) { Point.ByCoordinates(x<1>, y<1>, 0); }
watch_7 = Watch(code_block_6)
code_block_7 = CodeBlock { 10..15; }
# note: The numbers used inside the replication guides determine the order that the lists are laced. In this case, we iterate over "x" (index 1), and for each new item we do a complete iteration over "y" (index 2).
# Try switching the <1> and <2> replication guides!
# note: Lacing via a Code Block node allows you combine lacing strategies.
# In this case, the "y" and "z" arguments are laced together using Shortest Lacing, and then those pairs are laced with "x" using Cross Product.
code_block_8 = CodeBlock(x=code_block_2.out0, y=code_block_2.out1, z=code_block_7) { Point.ByCoordinates(x<1>, y<2>, z<2>); }
watch_8 = Watch(code_block_8)
# note: There are certain nodes for which lacing cannot be applied automatically.
# In this example, the List.Count node does not lace over its input. This is because the node already expects a list, and cannot determine automatically if you want the length of the outer list, or the inner lists.
code_block_9 = CodeBlock { {{1,2},{3,4, 5}}; }
count = List.Count(code_block_9)
watch_9 = Watch(count)
count_2 = List.Count()
# note: For cases such as this, there are explicit Lacing nodes provided in the Dynamo library.
# note: We can lace over List.Count using a List.Map node, which "maps" the List.Count function over the list.
map = List.Map(code_block_9, count_2)
watch_10 = Watch(map)
byCoordinates_4 = Point.ByCoordinates()
# note: Note: to turn Point.ByCoordinates into a function, you must disable its default values by right-clicking the input ports.
# In this example, "x" and "y" are now the function parameters.
code_block_10 = CodeBlock { 0..10; 0..5; }
# note: For multiple lists, you can use the List.LaceShortest, List.LaceLongest, or List.CrossProduct nodes.
# The "comb" argument must accept its inputs in the same order that the lists are passed in.
laceShortest = List.LaceShortest(byCoordinates_4, code_block_10.out0, code_block_10.out1)
watch_11 = Watch(laceShortest)
laceLongest = List.LaceLongest(byCoordinates_4, code_block_10.out0, code_block_10.out1)
watch_12 = Watch(laceLongest)
cartesianProduct = List.CartesianProduct(byCoordinates_4, code_block_10.out0, code_block_10.out1)
watch_13 = Watch(cartesianProduct)
# note: For functions that accept a list, declaring replication guides will force the function to lace over the sub-lists.
# Here, you can see our List.Map example, but done in a Code Block node.
code_block_11 = CodeBlock { l = {{1,2}, {3,4,5}}; List.Count(l); List.Count(l<1>); }
watch_14 = Watch(code_block_11.out1)
watch_15 = Watch(code_block_11.out2)
