# Dynamo graph Nested Lists.dyn (Dynamo 0.7.0.25080)

code_block = CodeBlock { List.Chop(List.Chop(1..100, 10), 2); }
# note: List.Flatten un-nests a list by a certain amount.
# Flatten will completely flatten a nested list, so that none of its contents are sub-lists.
flatten = Flatten(code_block)
watch = Watch(flatten)
code_block_2 = CodeBlock { 1; }
# note: List.DiagonalLeft and List.DiagonalRight get diagonal slices of a 2D list.
flatten_2 = List.Flatten(code_block, code_block_2)
watch_2 = Watch(flatten_2)
code_block_3 = CodeBlock { List.Chop(1..100, 10); }
code_block_4 = CodeBlock { 5; }
diagonalRight = List.DiagonalRight(code_block_3, code_block_4)
watch_3 = Watch(diagonalRight)
diagonalLeft = List.DiagonalLeft(code_block_3, code_block_4)
watch_4 = Watch(diagonalLeft)
code_block_5 = CodeBlock { 1..100; }
# note: Here we take a list and chop it into sublists of length 10.
code_block_6 = CodeBlock { 10; }
# note: The List.Chop node is used for chopping up a list into sublists.
chop = List.Chop(code_block_5, code_block_6)
watch_5 = Watch(chop)
# note: List.Transpose gets the columns of a 2D list.
transpose = List.Transpose(code_block_3)
watch_6 = Watch(transpose)
# note: List.Sublists builds on the basic sublist creation functionality provided by List.Chop. The "ranges" input takes in a list of indices to take from the list. The "offset" input is used to pick a new starting point for the next sublist.
# Here is an equivalent way to do List.Chop.
code_block_7 = CodeBlock { 1..100; }
code_block_8 = CodeBlock { 10; }
# note: "offset" is 10, meaning that every sublist will start 10 indices ahead of the previous.
# "ranges" is 0..9, meaning that for each new sublist, we want to take the first 10 elements from the current position in the original list.
code_block_9 = CodeBlock(amt=code_block_8) { 0..(amt-1); }
sublists = List.Sublists(code_block_7, code_block_9, code_block_8)
watch_7 = Watch(sublists)
code_block_10 = CodeBlock { 1..100; {0..5, 9, 7, 0, 0}; 3; }
# note: Basically, List.Sublist starts at the beginning of the list, then it gets items at the indices specified by the "ranges" input. These items become the first sublist. Next, it picks a new starting point for the next sublist by adding the "offset" input to the starting point of the current sublist. It repeats this pattern until the starting point is outside of the bounds of the original list.
sublists_2 = List.Sublists(code_block_10.out0, code_block_10.out1, code_block_10.out2)
watch_8 = Watch(sublists_2)
