# Dynamo graph Querying By Index.dyn (Dynamo 0.7.0.25080)

code_block = CodeBlock { 0..10; }
# note: Lists can easily be broken into a "first" and "rest".
# "First" refers to the first item in a list.
# "Rest" refers to the list with the first item removed.
deconstruct = List.Deconstruct(code_block)
watch = Watch(deconstruct.out0)
watch_2 = Watch(deconstruct.out1)
code_block_2 = CodeBlock { 0..10; }
code_block_3 = CodeBlock { 2; }
# note: List.DropItems removes a given amount of items from the start of a list.
dropItems = List.DropItems(code_block_2, code_block_3)
watch_3 = Watch(dropItems)
# note: Hint: try using a negative number for the amount.
code_block_4 = CodeBlock { 0..10; }
code_block_5 = CodeBlock { 3; }
# note: List.TakeItems retreives a given amount of items from the start of a list.
# note: List.DropEveryNthItem and List.TakeEveryNthItem operate on every "n" item in the list, where n is a given number.
dropEveryNthItem = List.DropEveryNthItem(code_block_4, code_block_5)
# note: Notice that if the inputs are identical, a Drop node returns all the items missing from a Take node.
watch_4 = Watch(dropEveryNthItem)
code_block_6 = CodeBlock { 1; }
dropEveryNthItem_2 = List.DropEveryNthItem(code_block_4, code_block_5, code_block_6)
watch_5 = Watch(dropEveryNthItem_2)
firstItem = List.FirstItem(code_block)
watch_6 = Watch(firstItem)
restOfItems = List.RestOfItems(code_block)
watch_7 = Watch(restOfItems)
code_block_7 = CodeBlock { 0..10; }
code_block_8 = CodeBlock { 3; }
# note: List.GetItemAtIndex and List.RemoveItemAtIndex operate on specific indices.
removeItemAtIndex = List.RemoveItemAtIndex(code_block_7, code_block_8)
watch_8 = Watch(removeItemAtIndex)
code_block_9 = CodeBlock { {1,2,5,9}; }
removeItemAtIndex_2 = List.RemoveItemAtIndex(code_block_7, code_block_9)
watch_9 = Watch(removeItemAtIndex_2)
takeItems = List.TakeItems(code_block_2, code_block_3)
watch_10 = Watch(takeItems)
takeEveryNthItem = List.TakeEveryNthItem(code_block_4, code_block_5, code_block_6)
watch_11 = Watch(takeEveryNthItem)
takeEveryNthItem_2 = List.TakeEveryNthItem(code_block_4, code_block_5)
watch_12 = Watch(takeEveryNthItem_2)
getItemAtIndex = List.GetItemAtIndex(code_block_7, code_block_9)
watch_13 = Watch(getItemAtIndex)
getItemAtIndex_2 = List.GetItemAtIndex(code_block_7, code_block_8)
watch_14 = Watch(getItemAtIndex_2)
code_block_10 = CodeBlock { 0..10; }
code_block_11 = CodeBlock { 2; }
code_block_12 = CodeBlock { 8; }
# note: List.Slice takes a start amount, an end amount, and a step amount. It then walks from the start index to the end index, taking items at each step interval.
slice = List.Slice(code_block_10, code_block_11, code_block_12)
watch_15 = Watch(slice)
code_block_13 = CodeBlock { 2; }
slice_2 = List.Slice(code_block_10, code_block_11, code_block_12, code_block_13)
watch_16 = Watch(slice_2)
code_block_14 = CodeBlock { -1; }
slice_3 = List.Slice(code_block_10, code_block_11, code_block_14)
watch_17 = Watch(slice_3)
# note: Start, end, and step can all be negative, just like list slices in Python.
code_block_15 = CodeBlock { -5; }
slice_4 = List.Slice(code_block_10, code_block_14, code_block_15, code_block_14)
watch_18 = Watch(slice_4)
