# Dynamo graph RangesAndSequences.dyn (Dynamo 0.7.0.21043)

code_block = CodeBlock { 0; }
code_block_2 = CodeBlock { 10; }
code_block_3 = CodeBlock { 2; }
code_block_4 = CodeBlock(start3=code_block, amount4=code_block_2, step5=code_block_3) { start3.. amount4*step5-step5+start3..step5; }
watch = Watch(code_block_4)
code_block_5 = CodeBlock { 0; }
code_block_6 = CodeBlock { 10; }
code_block_7 = CodeBlock { 2; }
code_block_8 = CodeBlock(start0=code_block_5, end1=code_block_6, step2=code_block_7) { start0..end1..step2; }
watch_2 = Watch(code_block_8)
number = DoubleInput(0..#10..2)
# note: insert ranges and sequences directly into number nodes following this syntax
# Start..End
# 0..4 will yield  0,1,2,3,4
# Start..End..Interval
# 0..4..2 will yield 0,2,4
# Start..End..#Count
# 0..1..#5 will yield 0, 0.25, 0.5, 0.75, 1
# Start..#List Length..Interval
# 0..#4..10 will yield 0,10,20,30
watch_3 = Watch(number)
code_block_9 = CodeBlock { 0..10..2; }
watch_4 = Watch(code_block_9)
code_block_10 = CodeBlock { 0..4; }
watch_5 = Watch(code_block_10)
number_2 = DoubleInput(0..#4..10)
watch_6 = Watch(number_2)
code_block_11 = CodeBlock { 0..4..2; }
watch_7 = Watch(code_block_11)
number_3 = DoubleInput(0..1..#5)
watch_8 = Watch(number_3)
# note: Additionally, you can insert variables within the ranges and sequences like 0..#a..50
code_block_12 = CodeBlock { 0..6.000; }
number_4 = DoubleInput(0..#a..50, code_block_12, lacing=Longest)
watch_9 = Watch(number_4)
