# Dynamo graph Reduce.dyn (Dynamo 0.7.0.21332)

add = _ + _
code_block = CodeBlock { 0; 1..10; }
# note: The List.Reduce node takes one or more lists and reduces them into a single value.
reduce = List.Reduce(add, code_block.out0, code_block.out1)
watch = Watch(reduce)
# note: In the first example, we are summing up a list of numbers.
# The initial sum of 0 is given as the "seed".
# Then Reduce takes an item from the list one at a time and adds it to the sum. It does this by calling the reducer function with the item in the list and the old sum. The result will be used as the new sum.
# Once there are no more items in the list, the sum is returned as the result. This is why if the list is empty, the seed is just returned: there's nothing from the list to call "reductor" with!
empty = List.Empty()
# note: The "reductor" input accepts a function to be used for reducing the list. This function accepts one item from each list being reduced, followed by the "current reduced value".
# note: This is done by iterating over the list and keeping a "current reduced value" that is constantly updated each time a new item in the list is visited.
# note: The "seed" input is used as the intial "current reduced value". If this list being reduced is empty, then this value is returned.
reduce_2 = List.Reduce(add, code_block.out0, empty)
watch_2 = Watch(reduce_2)
mul = _ * _
code_block_2 = CodeBlock { 1; 1..5; }
# note: In this example, we multiply a list of numbers.
reduce_3 = List.Reduce(mul, code_block_2.out0, code_block_2.out1)
watch_3 = Watch(reduce_3)
code_block_3 = CodeBlock { 1; }
add_2 = code_block_3 + _
# note: This composition produces a function that accepts a number and a list. The number has 1 added to it, and then is added to the start of the list.
# The number input will be each item coming in from the reduced list, and the list input will be the current reduced value.
addItemToEnd = List.AddItemToEnd()
# note: Here, we reimplement List.Map. Try replacing the + node with another single input function!
compose = ComposeFunctions(add_2, addItemToEnd)  # "Function.Compose"
empty_2 = List.Empty()
code_block_4 = CodeBlock { 0..4; }
reduce_4 = List.Reduce(compose, empty_2, code_block_4)
watch_4 = Watch(reduce_4)
add_3 = _ + _
# note: List.Scan can be useful to debug what's happening inside of a Reduce.
code_block_5 = CodeBlock { 0; 1..10; }
# note: List.Scan is similar to List.Reduce, except that it returns a list of each stage of the reduced value.
scan = ScanList(add_3, code_block_5.out0, code_block_5.out1)  # "List.Scan"
watch_5 = Watch(scan)
