# Dynamo graph Sorting.dyn (Dynamo 0.7.0.21332)

# note: If your list contains elements which are naturally ordered (such as strings or numbers) then you can get the min and max of the list or sort the list by using List.MinimumItem, List.MaximumItem, and List.Sort nodes.
code_block = CodeBlock { 0..10000; }
shuffle = List.Shuffle(code_block)
maximumItem = List.MaximumItem(shuffle)
watch = Watch(maximumItem)
minimumItem = List.MinimumItem(shuffle)
watch_2 = Watch(minimumItem)
sort = List.Sort(shuffle)
watch_3 = Watch(sort)
watch_4 = Watch(shuffle)
code_block_2 = CodeBlock { upper = 100; }
code_block_3 = CodeBlock(x=code_block_2) { 0..x; }
shuffle_2 = List.Shuffle(code_block_3)
shuffle_3 = List.Shuffle(code_block_3)
byCoordinates = Point.ByCoordinates(shuffle_2, shuffle_3)
X = Point.X()
# note: If the contents are not naturally ordered, however, these nodes will not suffice.
# Imagine the case where we want to sort a list of Points. Points can be ordered a multitude of different ways: X, Y, Z, Magnitude, Distance to another Point, etc.
# note: The SortByKey node allows you to specify a "keyProjector" function. This function receives items from the list being sorted and is used to extract an orderable value from the item (like a number).
sortByKey = SortByKey(byCoordinates, X)
watch_5 = Watch(sortByKey)
code_block_4 = CodeBlock(x=code_block_2) { Math.Random(0, x); Math.Random(0, x); }
byCoordinates_2 = Point.ByCoordinates(code_block_4.out0, code_block_4.out1)
distanceTo = Geometry.DistanceTo(arg1=byCoordinates_2)
# note: Here, we sort a list of points by the X coordinate by using a function that extracts the X coodinate from a Point.
# note: Here, we sort a list of Points by distance to another Point.
sortByKey_2 = SortByKey(byCoordinates, distanceTo)
watch_6 = Watch(sortByKey_2)
watch_7 = Watch(byCoordinates_2)
# note: The Dynamo library also provides MaximumItemByKey and MinimumItemByKey, which work similarly.
maximumItemByKey = MaximumItemByKey(byCoordinates, distanceTo)
watch_8 = Watch(maximumItemByKey)
minimumItemByKey = MinimumItemByKey(byCoordinates, distanceTo)
watch_9 = Watch(minimumItemByKey)
