# Dynamo graph tesselation.dyn (Dynamo 0.7.0.38229)

integer_slider = IntegerSlider(15, range=0..30)
code_block = CodeBlock { 2; }
pow = Math.Pow(integer_slider, code_block)
randomList = Math.RandomList(pow)
randomList_2 = Math.RandomList(pow)
byCoordinates = UV.ByCoordinates(randomList, randomList_2, lacing=Longest)
code_block_2 = CodeBlock(amount=integer_slider) { 0..1..#amount; }
byCoordinates_2 = UV.ByCoordinates(code_block_2, code_block_2, lacing=CrossProduct)
flatten = Flatten(byCoordinates_2)
select_face = DSFaceSelection()  # 1 picked in the model
byParametersOnSurface = Tessellation.Voronoi.ByParametersOnSurface(flatten, select_face)
watch_3d = Watch3D(byParametersOnSurface)
# note: Connect these to
# make Revit Stuff
byCurve = ModelCurve.ByCurve(lacing=Longest)
