# Dynamo graph tesselation_types.dyn (Dynamo 0.7.0.38229)

integer_slider = IntegerSlider(15, range=0..30)
code_block = CodeBlock { 2; }
pow = Math.Pow(integer_slider, code_block)
randomList = Math.RandomList(pow)
randomList_2 = Math.RandomList(pow)
byCoordinates = UV.ByCoordinates(randomList, randomList_2, lacing=Longest)
select_face = DSFaceSelection()  # 1 picked in the model
byParametersOnSurface = Tessellation.Voronoi.ByParametersOnSurface(byCoordinates, select_face)
watch_3d = Watch3D(byParametersOnSurface)
byParametersOnSurface_2 = Tessellation.Delaunay.ByParametersOnSurface(byCoordinates, select_face)
watch_3d_2 = Watch3D(byParametersOnSurface_2)
pointAtParameter = Surface.PointAtParameter(select_face, randomList, randomList_2, lacing=Longest)
byPoints = Tessellation.ConvexHull.ByPoints(pointAtParameter)
watch_3d_3 = Watch3D(byPoints)
