# Dynamo graph OverrideGraphicsInView_Families.dyn (Dynamo 0.7.0.35434)

family_types = FamilyTypes(index=4)
# note: get family instances
all_elements_of_family_type = ElementsOfFamilyType(family_types)
number = DoubleInput(0)
number_2 = DoubleInput(255)
byARGB = Color.ByARGB(number, number, number_2, number, lacing=Longest)
number_3 = DoubleInput(0)
number_4 = DoubleInput(255)
byARGB_2 = Color.ByARGB(number_3, number_4, number_3, number_3, lacing=Longest)
# note: chose family parameter to track
string = StringInput("deflection")
getParameterValueByName = Element.GetParameterValueByName(all_elements_of_family_type, string, lacing=Longest)
value = DynamoUnits.SIUnit.Value(getParameterValueByName)
# note: get highest value
maximumItem = List.MaximumItem(value)
div = value / maximumItem
# note: set color range
color_range = ColorRange(byARGB, byARGB_2, div)
overrideColorInView = Element.OverrideColorInView(all_elements_of_family_type, color_range, lacing=Longest)
number_5 = DoubleInput(0.5)
# note: normalize at highest value
# note: identify panels within a tolerance
# note: or
formula = Formula("if(x>y,1,0)", x=value, y=number_5, lacing=Longest)
