# Dynamo graph OverrideGraphicsInView_Walls.dyn (Dynamo 0.7.0.35434)

double_slider = DoubleSlider(3.57, range=1..25)
# note: This definition can be run in any Revit .rvt (project) file
number = DoubleInput(0..50..x, double_slider, lacing=Longest)
byCoordinates = Point.ByCoordinates(number, lacing=Longest)
code_block = CodeBlock { 0; 10; }
byCoordinates_2 = Vector.ByCoordinates(code_block.out0, code_block.out1)
add = Point.Add(byCoordinates, byCoordinates_2, lacing=Longest)
byStartPointEndPoint = Line.ByStartPointEndPoint(byCoordinates, add, lacing=Longest)
number_2 = DoubleInput(10)
levels = Levels(index=0)
wall_types = WallTypes(index=1)
byCurveAndHeight = Wall.ByCurveAndHeight(byStartPointEndPoint, number_2, levels, wall_types, lacing=Longest)
number_3 = DoubleInput(0)
number_4 = DoubleInput(255)
byARGB = Color.ByARGB(number_3, number_3, number_4, number_3, lacing=Longest)
number_5 = DoubleInput(0)
number_6 = DoubleInput(255)
byARGB_2 = Color.ByARGB(number_5, number_6, number_5, number_5, lacing=Longest)
byCoordinates_3 = Point.ByCoordinates(lacing=Longest)
distanceTo = Geometry.DistanceTo(byCoordinates_3, byCoordinates, lacing=Longest)
formula = Formula("x/50", x=distanceTo, lacing=Longest)
# note: set color range
color_range = ColorRange(byARGB, byARGB_2, formula)
overrideColorInView = Element.OverrideColorInView(byCurveAndHeight, color_range, lacing=Longest)
