# Dynamo graph Basics_Basic02.dyn (Dynamo 0.7.0.11908)

byCoordinates = Point.ByCoordinates()
# note: Geometric Data can be visualized as either textual information or in 3d space
watch = Watch(byCoordinates)
# note: You can toggle between 3d navigation and node navigation with the Geom/Node Butttons in the lower right of the screen.  Background Preview can also be turned on and off in the View Menu
number = DoubleInput(2)
double_slider = DoubleSlider(4.43, range=0..10)
byCoordinates_2 = Point.ByCoordinates(number, arg2=double_slider)
byStartPointEndPoint = Line.ByStartPointEndPoint(byCoordinates_2, byCoordinates)
watch_3d = Watch3D(byStartPointEndPoint)
byCurve = ModelCurve.ByCurve(byStartPointEndPoint)
# note: Dynamo interacts with Revit with special Revit nodes.
# Dynamo can only create and modify elements that are appropriate to the file that Dynamo is associated with.  For instance, Reference Points can only be made in certain Family environments, while Model Lines can be created almost anywhere.
byPoint = ReferencePoint.ByPoint(byCoordinates_2)
