# Dynamo graph Basics_Basic03.dyn (Dynamo 0.7.0.11908)

# note: Lists of Data can be generated with sequences and ranges.  These lists can be reorganized with many other nodes for specific purposes
number = DoubleInput(0)
number_2 = DoubleInput(9)
number_3 = DoubleInput(1)
number_range = NumberRange(number, number_2, number_3, lacing=Longest)
watch = Watch(number_range)
number_4 = DoubleInput(3)
chop = List.Chop(number_range, number_4)
watch_2 = Watch(chop)
lastItem = List.LastItem(number_range)
watch_3 = Watch(lastItem)
