# Dynamo graph Core_AttractorPoint.dyn (Dynamo 0.7.0.40046)

# note: Range syntax: 1 to 50, skipping by 5's
# note: ATTRACTOR POINT
# Scripting 101.
# An attractor point is a quick way to make variation across a field of objects.  It works by creating a grid of objects that have some parameter determined by the distance between the object and a point that moves around.
# To visualize what's going on, move the two sliders that control the location of the attractor point.
number = DoubleInput(1..50..5)
# note: Grid of points.
# To make, pass a series of numbers into at least two ports.  Change the lacing behavior of the node to "Cross product"
byCoordinates = Point.ByCoordinates(number, number, lacing=CrossProduct)
# note: Flatten the list because the hierarchy of rows and columns is not needed.  Compare the input to this node with the output.
flatten = Flatten(byCoordinates)
code_block = CodeBlock { 0; }
number_slider = DoubleSlider(28.6701556, range=-10..60)
number_slider_2 = DoubleSlider(11.50111001, range=-10..60)
# note: Attractor Point.  Move the input sliders to adjust the location of this point.
byCoordinates_2 = Point.ByCoordinates(number_slider, number_slider_2)
# note: Finds the distance between the attractor point and the base point of the cylinders
distanceTo = Geometry.DistanceTo(flatten, byCoordinates_2, lacing=Longest)
# note: Formula to make the height of the cylinders react to the location of the attractor point.  Can be different from the formula controlling the radii.
code_block_2 = CodeBlock(x=distanceTo) { x/2; }
byCoordinates_3 = Vector.ByCoordinates(code_block, code_block, code_block_2)
# note: Add this new z-value (height) to the original grid points to get the top points for the cylinders.
add = Point.Add(flatten, byCoordinates_3)
# note: Formula adjusts the amount of variation between the radii of the cylinders.  Try using a different formula.
code_block_3 = CodeBlock(x=distanceTo) { x/15; }
byPointsRadius = Cylinder.ByPointsRadius(flatten, add, code_block_3)
