# Dynamo graph Geometry_Points.dyn (Dynamo 0.7.0.33416)

double_slider = DoubleSlider(5.637518363, range=0..10)
# note: Basic Geometric Elements have default values for numerical inputs.
byCoordinates = Point.ByCoordinates(arg2=double_slider)
# note: After hitting "Run" or with Run Automatically enabled, see the geometric entity either in the Background Peview, in Watch 3d, or as data in a Watch node.  Elements will highlight in Background when the node is selected
watch_3d = Watch3D(byCoordinates)
number = DoubleInput(0)
number_2 = DoubleInput(10)
number_3 = DoubleInput(1)
# note: Arrays of Geometry can be created using Sequences, Ranges, and Lists
number_range = NumberRange(number, number_2, number_3, lacing=Longest)
# note: Make 1, 2, and 3 dimensional arrays by passing Ranges into the points x, y, and z ports, then changing the Lacing properties in the right click menue for the node
byCoordinates_2 = Point.ByCoordinates(arg1=number_range)
watch = Watch(byCoordinates)
asVector = Point.AsVector(watch)
# note: Derivative elements can be created by using tools in the Actions subcategory of the entity
add = Point.Add(byCoordinates_2, asVector)
# note: Information Can be pulled out of Geometry using tools in the Query subcategory of the entiry
Z = Point.Z(byCoordinates)
