# Dynamo graph Revit_Color.dyn (Dynamo 0.7.0.42482)

# note: Get Walls
# note: Run this graph the DynamoSample.rvt file in the Samples folder located with your Dynamo installation
# C:\ProgramData\Dynamo\0.7\samples\Revit
# note: Color Revit Elements based on some measurable criteria
select_model_elements = DSModelElementsSelection()  # 10 picked in the model
number = DoubleInput(0)
number_2 = DoubleInput(255)
byARGB = Color.ByARGB(number, number, number_2, number, lacing=Longest)
number_3 = DoubleInput(0)
number_4 = DoubleInput(255)
byARGB_2 = Color.ByARGB(number_3, number_4, number_3, number_3, lacing=Longest)
geometry = Element.Geometry(select_model_elements)
flatten = Flatten(geometry)
# note: Extract Surface Area of Geometry
area = Solid.Area(flatten)
# note: normalize at highest value
maximumItem = List.MaximumItem(area)
div = area / maximumItem
# note: set color range
color_range = ColorRange(byARGB, byARGB_2, div)
overrideColorInView = Element.OverrideColorInView(select_model_elements, color_range, lacing=Longest)
number_5 = DoubleInput(50)
# note: get highest value
# note: identify areas within a tolerance
# note: or
formula = Formula("if(x>y,1,0)", x=area, y=number_5, lacing=Longest)
