# Dynamo graph Revit_Floors and Framing.dyn (Dynamo 0.7.0.11908)

# note: Center Of Folly
# note: Run this graph the DynamoSample.rvt file in the Samples folder located with your Dynamo installation
code_block = CodeBlock { Point.ByCoordinates(60,-40,-1); }
# note: # Levels
code_block_2 = CodeBlock { 5; }
number = DoubleInput(10..5..#x, code_block_2, lacing=Longest)
byCenterPointRadius = Circle.ByCenterPointRadius(code_block, number)
code_block_3 = CodeBlock { 5; }
regularPolygon = Polygon.RegularPolygon(byCenterPointRadius, code_block_3)
code_block_4 = CodeBlock(x=code_block_2) { 0; 0..50..#x; }
byCoordinates = Vector.ByCoordinates(code_block_4.out0, code_block_4.out0, code_block_4.out1)
translate = Geometry.Translate(regularPolygon, byCoordinates)
ZAxis = Vector.ZAxis()
code_block_5 = CodeBlock(count=code_block_2) { 0..45..#count; }
rotate = Geometry.Rotate(translate, code_block, ZAxis, code_block_5)
curves = PolyCurve.Curves(rotate)
floor_types = FloorTypes()
levels = Levels()
byOutlineTypeAndLevel = Floor.ByOutlineTypeAndLevel(curves, floor_types, levels)
endPoint = Curve.EndPoint(curves)
transpose = List.Transpose(endPoint)
byPoints = PolyCurve.ByPoints(transpose)
curves_2 = PolyCurve.Curves(byPoints)
levels_2 = Levels()
ZAxis_2 = Vector.ZAxis()
beam = StructuralType.Beam()
structural_framing_types = StructuralFramingTypes()
byCurveLevelUpVectorAndType = StructuralFraming.ByCurveLevelUpVectorAndType(curves_2, levels_2, ZAxis_2, beam, structural_framing_types)
