# Dynamo graph Revit_Floors and Framing_simple.dyn (Dynamo 0.7.0.33416)

code_block = CodeBlock { 30; }
byOrigin = CoordinateSystem.ByOrigin(code_block, code_block)
code_block_2 = CodeBlock { 10; }
byWidthHeight = Rectangle.ByWidthHeight(byOrigin, code_block_2, code_block_2)
floor_types = FloorTypes(index=3)
levels = Levels(index=2)
byOutlineTypeAndLevel = Floor.ByOutlineTypeAndLevel(byWidthHeight, floor_types, levels)
curves = PolyCurve.Curves(byWidthHeight)
byCurve = ModelCurve.ByCurve(curves)
