# Dynamo graph Revit_ImportSolid.dyn (Dynamo 0.7.0.42482)

# note: Model Lines have been  pre-selected from Revit, Element IDs saved with the Dynamo file
# note: Run this graph the DynamoSample.rvt file in the Samples folder located with your Dynamo installation
# C:\ProgramData\Dynamo\0.7\samples\Revit
# note: Import a solid form into Revit
select_model_element = DSModelElementSelection()  # 1 picked in the model
curve = CurveElement.Curve(select_model_element)
code_block = CodeBlock { 0..1..#9; }
pointAtParameter = Curve.PointAtParameter(curve, code_block)
select_model_element_2 = DSModelElementSelection()  # 1 picked in the model
curve_2 = CurveElement.Curve(select_model_element_2)
pointAtParameter_2 = Curve.PointAtParameter(curve_2, code_block)
select_model_element_3 = DSModelElementSelection()  # 1 picked in the model
curve_3 = CurveElement.Curve(select_model_element_3)
pointAtParameter_3 = Curve.PointAtParameter(curve_3, code_block)
byThreePoints = Arc.ByThreePoints(pointAtParameter, pointAtParameter_2, pointAtParameter_3)
number = DoubleInput(1)
extendStart = Curve.ExtendStart(byThreePoints, number)
extendEnd = Curve.ExtendEnd(extendStart, number)
byLoft = Surface.ByLoft(extendEnd)
number_2 = DoubleInput(0.5)
thicken = Surface.Thicken(byLoft, number_2)
byGeometries = ImportInstance.ByGeometries(thicken)
