# Dynamo graph Create a Graph.dyn "Vytvořit graf" (Dynamo 4.0.0.3076)
# author: Dynamo
# Tento dokument vám pomůže seznámit se se standardizovaným pracovním postupem a s následujícími důležitými kroky.

# group: JAK VYTVOŘIT GRAF APLIKACE DYNAMO > Příklad
# note: Generátor názvů

# group: Standardy pojmenování skupin Vstupy → Akce → Výstupy → Kontrola > Vstupy
# UŽIVATELEM ŘÍZENÉ HODNOTY, KTERÉ DEFINUJÍ CÍLOVÁ DATA A NASTAVENÍ PŘED TÍM, NEŽ DOJDE K JAKÉMUKOLIV ZPRACOVÁNÍ
# note: POUŽITÍ: Všechny hodnoty řízené uživatelem, které definují, co graf zpracuje a jak by se měl chovat.
# například posuvníky čísel, řetězce, cesty k souborům, booleovské přepínače, rozevírací seznamy a počáteční seznamy.

# group: Standardy pojmenování skupin Vstupy → Akce → Výstupy → Kontrola > Akce
# ZÁKLADNÍ OPERACE, KTERÉ ZPRACOVÁVAJÍ VSTUPY
# note: POUŽITÍ: Hlavní produkční řetězec zpracování, který transformuje vstupy na výsledky. Zde se odehrává „práce“, například čištění seznamu, mapování, filtrování, logika řetězců, operace s geometrií, formátování, převody.

# group: Standardy pojmenování skupin Vstupy → Akce → Výstupy → Kontrola > Výstupy
# KONEČNÉ VÝSLEDKY VYTVOŘENÉ GRAFEM, PŘIPRAVENÉ K EXPORTU NEBO NÁSLEDNÉMU POUŽITÍ
# note: POUŽITÍ: Konečné výsledky určené k následnému použití (exportované, připojené k jinému grafu), například konečné seznamy, formátované řetězce, vypočtené hodnoty, slovníky/tabulky, data připravená k exportu

# group: Standardy pojmenování skupin Vstupy → Akce → Výstupy → Kontrola > Kontrola
# LADICÍ A KONTROLNÍ VÝSTUPY SLOUŽÍCÍ K OVĚŘENÍ VÝSLEDKŮ BEZ OVLIVNĚNÍ HLAVNÍCH VÝSTUPŮ.
# note: POUŽITÍ: Kontroly čitelné pro člověka, abyste mohli ověřit, že graf dělá to, co očekáváte, beze změny výsledků, například uzly sledování, List.Count, souhrnné řetězce, příznaky „PASS/FAIL“, seznamy chyb, náhled geometrie (Watch3D), ukázkové výstupy.

# group: Standardy pojmenování skupin Vstupy → Akce → Výstupy → Kontrola > Poznámky
# note: POUŽITÍ:
# PRO KOMENTÁŘE A INFORMACE O SKRIPTU

# group: Informace o grafu
# metadata, barevná legenda, pravidla pojmenování
# note: PROJEKT APLIKACE DYNAMO
# Vytvořit graf
# note: VERZE APLIKACE DYNAMO
# 4.1.0
# note: VERZE HOSTITELSKÉ APLIKACE
# N/A
# note: ASOCIOVANÉ SOUBORY
# N/A
# note: POŽADOVANÉ BALÍČKY APLIKACE DYNAMO
# N/A
# note: AUTOR (AUTOŘI) / DATUM VYTVOŘENÍ
# Archilizer for Dynamo Team / 4. února 2026
# note: DALŠÍ KOMENTÁŘE
# N/A
# note: POPIS
# Tento dokument vám pomůže seznámit se se standardizovaným pracovním postupem a s následujícími důležitými kroky.

# group: JAK VYTVOŘIT GRAF APLIKACE DYNAMO > Informace o grafu
# metadata, barevná legenda, pravidla pojmenování
# note: PROJEKT APLIKACE DYNAMO
# Viz Standardy pojmenování souborů grafů
# note: VERZE APLIKACE DYNAMO
# note: VERZE HOSTITELSKÉ APLIKACE
# note: ASOCIOVANÉ SOUBORY
# note: POŽADOVANÉ BALÍČKY APLIKACE DYNAMO
# note: AUTOŘI / DATUM VYTVOŘENÍ
# note: DALŠÍ KOMENTÁŘE
# note: POPIS
# Popis grafu by měl uvádět:
# co graf dělá, jaká data používá,
# jaká pravidla aplikuje, jaký má výstup,
# Kde a jak se spouští (hostitelská aplikace + verze) a případná klíčová omezení

# group: JAK VYTVOŘIT GRAF APLIKACE DYNAMO > Přehrávač skriptů Dynamo Vstupy → Akce → Výstupy
# Přehrávač skriptů Dynamo umožňuje spouštění grafů aplikace Dynamo bez otevření rozhraní aplikace Dynamo.
# Uživatelé interagují pouze s předdefinovanými vstupy a spouštějí skript
# note: Klikněte pravým tlačítkem na vstupní uzel a vyberte možnost „Je vstup“
váš_vstup = StringInput("Přehrávač skriptů Dynamo")  # graph input
vaše_akce = String.ToUpper(string=váš_vstup)
# note: Klikněte pravým tlačítkem na vstupní uzel a vyberte možnost „Je výstup“.
váš_výstup = Watch(vaše_akce)  # graph output

# group: JAK VYTVOŘIT GRAF APLIKACE DYNAMO > Standardy pojmenování uzlů
# note: Neměňte celý název uzlu. Místo toho použijte závorky na konci.
string = StringInput("")
# note: UDĚLAT
řetězec_vstup_1 = StringInput("")
# note: NEDĚLAT
# note: Aktualizujte tato pravidla podle vašich podnikových standardů.
vstup_1 = StringInput("")
typická_pravidla_co_dělat = CodeBlock()  # "Typická pravidla co dělat/nedělat"
# ---------- typická_pravidla_co_dělat.designscript (12 lines) ----------
/*
Do:
Rename key nodes only (inputs, rules, outputs, decision logic)
Use notes to add context to your script
Use capitalization consistently (e.g. Title Case or camelCase, not mixed)
*/

/*Do Not:
Rename every node in the graph
Leave important nodes with default names if they affect logic
Use vague names like "Data", "Stuff", "Fix", "Test"
*/;
# ----------------------------------------

# group: JAK VYTVOŘIT GRAF APLIKACE DYNAMO > Standardy pojmenování souborů grafů
# Abyste porozuměli účelu nebo zamýšlenému použití grafu dle jeho názvu, doporučujeme použití vzoru pojmenování podobného konvenci prováděcího plánu BIM:
string_2 = StringInput("-")
organizace = CodeBlock { "AUT"; }
pole_funkcí = CodeBlock { BLD  = "BLD"; STR  = "STR"; MEP  = "MEP"; INFR = "INFR"; }
popis = CodeBlock { "Logical_description"; }
verze_aplikace_dynamo = CodeBlock { "D303"; }
verze_skriptu_pouze_pro_záložní = CodeBlock { "V2"; }  # "Verze skriptu (pouze pro záložní soubory)"
pořadí_sestavy = String.Join(separator=string_2, string0=organizace, string1=pole_funkcí.BLD, string2=popis, string3=verze_aplikace_dynamo, string4=verze_skriptu_pouze_pro_záložní)
příklad_názvu = Watch(pořadí_sestavy)
# note: Doporučená struktura pojmenování
struktura_pojmenování = CodeBlock()
# ---------- struktura_pojmenování.designscript (3 lines) ----------
["Organisation  | Function fields | Description         | Dynamo-Version | Script-Version",
"AUT            |BLD              | Logical_description | D303           | V3"
];
# ----------------------------------------
# note: NEUPRAVOVAT :
# note: Pole Funkce popisují hlavní pracovní oblast nebo doménu skriptu
pole_funkcí_2 = CodeBlock()
# ---------- pole_funkcí_2.designscript (4 lines) ----------
BLD  = "BLD  — Building design";
STR  = "STR  — Structural design";
MEP  = "MEP  — Mechanical / Electrical / Plumbing";
INFR = "INFR — Infrastructure";
# ----------------------------------------

# group: JAK VYTVOŘIT GRAF APLIKACE DYNAMO
# Vizuální průvodce strukturou, pojmenováním a nejlepšími postupy
# note: Uzly Watch použijte pouze u klíčových kontrolních bodů
# Zmrazit neaktivní skript
# note: Před spuštěním grafu:
# Zkontrolujte, zda jsou nastaveny vstupy.
# Zkontrolujte náhled/kontroly
# Před použitím Přehrávače skriptů Dynamo spusťte jednou ručně
# Po úspěšném spuštění uložte soubor
# note: Tento dokument vám pomůže seznámit se se standardizovaným pracovním postupem a s následujícími důležitými kroky.
# note: Pozadí / zadní panel
informace = CodeBlock()
# ---------- informace.designscript (5 lines) ----------
"To keep Dynamo graphs neat and readable, we recommend following a clear
structure.

For more information, read the Dynamo Primer page on best-practice graph strategies:
https://primer2.dynamobim.org/9_best_practices/1-graph-strategies";
# ----------------------------------------
