# Dynamo graph Import & Export Workflow.dyn "Pracovní postup importu a exportu" (Dynamo 4.0.0.3076)
# author: Dynamo
# Tento dokument vám pomůže seznámit se s různými způsoby importu a exportu souborů aplikace Excel a CSV.

# group: Definice klíčových slov > Poznámky
# note: Upravte tento seznam tak, aby odpovídal konvencím pojmenování v rámci vaší kanceláře

# group: Informace o grafu
# metadata, barevná legenda, pravidla pojmenování
# note: PROJEKT APLIKACE DYNAMO
# Pracovní postup importu a exportu
# note: VERZE APLIKACE DYNAMO
# 4.1.0
# note: VERZE HOSTITELSKÉ APLIKACE
# N/A
# note: ASOCIOVANÉ SOUBORY
# Excel_Import_Example.xlsx
# CSV_Import_Example.csv
# Geometry_Import_Example.sat
# note: POŽADOVANÉ BALÍČKY APLIKACE DYNAMO
# N/A
# note: AUTOR (AUTOŘI) / DATUM VYTVOŘENÍ
# Archilizer for Dynamo Team / 4. února 2026
# note: DALŠÍ KOMENTÁŘE
# N/A
# note: POPIS
# Tento dokument vám pomůže seznámit se s různými způsoby importu a exportu souborů aplikace Excel a CSV.
# Současně lze použít pouze jednu vstupní metodu. Zmrazte skripty, které se nepoužívají.

# group: Kontrola
# LADICÍ A KONTROLNÍ VÝSTUPY SLOUŽÍCÍ K OVĚŘENÍ VÝSLEDKŮ BEZ OVLIVNĚNÍ HLAVNÍCH VÝSTUPŮ.
# note: POUŽITÍ: Kontroly čitelné pro člověka, abyste mohli ověřit, zda graf dělá to, co očekáváte, aniž by se měnily výsledky, například uzly sledování, List.Count, souhrnné řetězce, příznaky „PASS/FAIL“, seznamy chyb, geometrie náhledu (Watch3D) a ukázkové výstupy.

# group: Poznámky
# note: POUŽITÍ:
# PRO KOMENTÁŘE A INFORMACE O SKRIPTU.

# group: Výstupy
# KONEČNÉ VÝSLEDKY VYTVOŘENÉ GRAFEM, PŘIPRAVENÉ K EXPORTU NEBO NÁSLEDNÉMU POUŽITÍ
# note: POUŽITÍ: Konečné výsledky určené k následnému použití (exportované, připojené k jinému grafu), například konečné seznamy, formátované řetězce, vypočtené hodnoty, slovníky/tabulky a data připravená k exportu.

# group: Vstupy
# UŽIVATELEM ŘÍZENÉ HODNOTY, KTERÉ DEFINUJÍ CÍLOVÁ DATA A NASTAVENÍ PŘED TÍM, NEŽ DOJDE K JAKÉMUKOLIV ZPRACOVÁNÍ
# note: POUŽITÍ: Všechny hodnoty řízené uživatelem, které definují, co graf zpracuje a jak by se měl chovat.
# Například posuvníky čísel, řetězce, cesty k souborům, booleovské přepínače, rozevírací seznamy a počáteční seznamy.

# group: Akce
# ZÁKLADNÍ OPERACE, KTERÉ ZPRACOVÁVAJÍ VSTUPY
# note: POUŽITÍ: Hlavní produkční řetězec zpracování, který transformuje vstupy na výsledky. Zde se odehrává „práce“, například čištění seznamu, mapování, filtrování, logika řetězců, operace s geometrií, formátování a převody.

# group: Import/export souborů CSV
# Tento skript importuje CSV data, analyzuje je a restrukturalizuje podle definovaných pravidel pojmenování a odděluje platné a neplatné položky za účelem kontroly a opravy. V tomto pracovním postupu je seznam názvů zpracován pomocí logiky ověřování založené na pravidlech, seřazen podle konvencí pojmenování a klasifikován do platných a neplatných skupin. Platné názvy jsou exportovány pro následné použití, například pro koordinaci a tvorbu zpráv
# note: transponujte seznam, pokud chcete číst sloupce.
# netransponujte seznam, pokud chcete číst řádky
# note: Tipy: Po zadání přidejte uzel sledování a ověřte, jak je soubor importován

# group: Import do aplikace Excel
# Nastaveno na hodnotu false při čtení čísel.
# Nastaveno na hodnotu true při čtení textu.
boolean = BoolSelector(false)

# group: Import do aplikace Excel
# Importujte data ze souboru aplikace Excel (.xlsx) do aplikace Dynamo a převede řádky a sloupce tabulky na strukturované seznamy pro zpracování, ověřování a manipulaci. Mezi obvyklá použití patří výkazy, parametry a množství pro následné pracovní postupy
cesta_k_souboru = Filename("..\..\..\..\..\..\Desktop\Excel_Import_Example.xlsx")
string = StringInput("sheet1")
openXMLImportExcel = Data.OpenXMLImportExcel(filePath=cesta_k_souboru, sheetName=string, readAsString=boolean)
# note: Pomocí metody List.Transpose načtěte sloupce seznamu.
# Netransponujte, abyste si mohli číst řádky seznamu.
transpose = List.Transpose()  # unwired: lists

# group: Import/export do aplikace Excel > Strukturování dat pro aplikaci Excel
# Odstraní položky s hodnotou null / prázdné položky a odebere záhlaví
# note: Načíst záhlaví
deconstruct = List.Deconstruct(list=openXMLImportExcel)
boolean_2 = BoolSelector(false)
clean = List.Clean(list=deconstruct.rest, preserveIndices=boolean_2)

# group: Import/export do aplikace Excel > Seskupit podle podobnosti
# Příklad manipulace s daty pro aplikaci Excel
transpose_2 = List.Transpose(lists=clean)
blok_kódu_index_sloupce = CodeBlock { 1; }
# note: Používá se pouze k extrahování jednoho klíčového sloupce
getItemAtIndex = List.GetItemAtIndex(list=transpose_2, index=blok_kódu_index_sloupce)
číslo = DoubleInput(0)
boolean_3 = BoolSelector(false)
groupBySimilarity = List.GroupBySimilarity(list=getItemAtIndex, tolerance=číslo, considerAdjacency=boolean_3)

# group: Import/export do aplikace Excel > Extrahování sloupce podlaží
# Potvrdí index sloupce
sledování = Watch(getItemAtIndex)

# group: Import/export souborů CSV > Csv Import
# Importuje data CSV do aplikace Dynamo a strukturuje je pro pracovní postupy ověřování, třídění a klasifikace založené na pravidlech
cesta_k_souboru_2 = Filename("..\Data\CSV_Import_Example.csv")
boolean_4 = BoolSelector(true)
importCSV = Data.ImportCSV(filePath=cesta_k_souboru_2, transpose=boolean_4)

# group: Import/export souborů CSV > Strukturování dat pro Csv
# strukturování dat: Slučuje a čistí vstup, takže následná pravidla vždy obdrží konzistentní seznam řetězců (žádné hodnoty null, žádné vnořené seznamy, čistý formát).
deconstruct_2 = List.Deconstruct(list=importCSV)
transpose_3 = List.Transpose(lists=deconstruct_2.rest)
blok_kódu_index_načítaného = CodeBlock { 0; }  # "Blok kódu (index načítaného sloupce)"
getItemAtIndex_2 = List.GetItemAtIndex(list=transpose_3, index=blok_kódu_index_načítaného)
boolean_5 = BoolSelector(false)
clean_2 = List.Clean(list=getItemAtIndex_2, preserveIndices=boolean_5)

# group: Import/export souborů CSV > Kontrola
# Zkontrolovat extrahování hlaviček
sledování_záhlaví = Watch(deconstruct_2.first)

# group: Definice klíčových slov
# Uživatelsky upravitelná nastavení, která definují pravidla pojmenování v rámci kanceláře, která se používají v kontrolách (velká písmena, klíčová slova a povinný oddělovač). Aktualizujte je, aby odpovídala vašemu projektu nebo kancelářskému standardu
toUpper = String.ToUpper(string=clean_2)
blok_kódu = CodeBlock { "-"; }
blok_kódu_2 = CodeBlock()
# ---------- blok_kódu_2.designscript (2 lines) ----------
// one output list
["GA","DET","STRUCT"];
# ----------------------------------------
blok_kódu_3 = CodeBlock { 0; }
blok_kódu_4 = CodeBlock { 1; }
blok_kódu_5 = CodeBlock { 2; }

# group: Import/export souborů CSV > Kontroly pravidel (velká písmena + oddělovač)
# generuje výstupy booleovských pravidel podle jména. Zkontroluje, zda je každý název psán velkými písmeny a zda obsahuje povinný oddělovací řetězec
eq = clean_2 == toUpper
contains = String.Contains(string=clean_2, searchFor=blok_kódu)

# group: Import/export souborů CSV > Kontrola klíčových slov (obsahuje libovolné klíčové slovo)
# zkontroluje, zda každý název obsahuje alespoň jedno schválené klíčové slovo. Vytvoří seznam booleovských hodnot, kde každá položka odpovídá odpovídajícímu názvu.
getItemAtIndex_3 = List.GetItemAtIndex(list=blok_kódu_2, index=blok_kódu_3)
contains_2 = String.Contains(string=clean_2, searchFor=getItemAtIndex_3)
getItemAtIndex_4 = List.GetItemAtIndex(list=blok_kódu_2, index=blok_kódu_4)
contains_3 = String.Contains(string=clean_2, searchFor=getItemAtIndex_4)
or_ = Or(bool0=contains_2, bool1=contains_3)
getItemAtIndex_5 = List.GetItemAtIndex(list=blok_kódu_2, index=blok_kódu_5)
contains_4 = String.Contains(string=clean_2, searchFor=getItemAtIndex_5)
or_2 = Or(bool0=or_, bool1=contains_4)

# group: Import/export souborů CSV > Spojit kontroly do konečné masky
# kombinuje všechny výstupy pravidel do jedné konečné booleovské masky za použití logiky AND. Tato maska definuje, zda je každý název platný nebo neplatný.
and_ = And(bool0=eq, bool1=contains)
and_2 = And(bool0=and_, bool1=or_2)

# group: Import/export souborů CSV > Platné vs. neplatné názvy
# výstupy: Rozdělí seznam názvů vstupů na platné a neplatné výsledky podle konečné masky
filterByBoolMask = List.FilterByBoolMask(list=clean_2, mask=and_2)

# group: Import/export souborů CSV > Ladění a souhrn
# Vizuální kontroly k potvrzení vstupů, pravidel a výstupů
platné_názvy = Watch(filterByBoolMask.in)
neplatné_názvy = Watch(filterByBoolMask.out)

# group: Import/export souborů CSV > Exportovat do formátu CSV
# exportuje platné sady názvů
cesta_k_souboru_3 = Filename("..\..\..\..\..\..\Desktop\CSV_Export_Example")
exportCSV = Data.ExportCSV(filePath=cesta_k_souboru_3, data=filterByBoolMask.in)

# group: Import/export do aplikace Excel > Kontrola / seskupené hodnoty podlaží
# Náhled seskupených hodnot podlaží po seskupení dle podobnosti. Slouží k ověření správnosti konzistence seskupování a pojmenování
sledování_2 = Watch(groupBySimilarity.groupedValues)

# group: Import/export do aplikace Excel > Kontrola / seskupené hodnoty podlaží
# Náhled seskupených hodnot podlaží po seskupení dle podobnosti. Slouží k ověření správnosti konzistence seskupování a pojmenování
sledování_3 = Watch(groupBySimilarity.groupedIndices)

# group: Import/export do aplikace Excel
# Tento skript importuje strukturovaná data z aplikace Excel, zpracuje je a přeorganizuje podle definovaných pravidel a exportuje transformovaný výsledek pro externí použití. V rámci tohoto pracovního postupu se importuje, analyzuje a přeuspořádá seznam místností podle umístění, přičemž se místnosti seskupí do strukturovaných seznamů podle prostorových kritérií. Zpracovaná data jsou poté exportována k použití v koordinaci a při tvorbě zpráv.
posuvník_celých_čísel = IntegerSlider(1, range=0..2 step 1)

# group: Import/export do aplikace Excel > Vložit hlavičky před exportem (volitelné)
# Vloží řádek záhlaví na začátek exportovaných dat.
# note: Používá metodu GroupedIndices ke stažení původních řádků
getItemAtIndex_6 = List.GetItemAtIndex(list=clean, index=groupBySimilarity.groupedIndices)
flatten = List.Flatten(list=getItemAtIndex_6, amount=posuvník_celých_čísel)
posuvník_celých_čísel_2 = IntegerSlider(0, range=0..2 step 1)
# note: Před exportem vloží hlavičky s indexem 0
insert = List.Insert(list=flatten, element=deconstruct.first, index=posuvník_celých_čísel_2)

# group: Import/export do aplikace Excel > Kontrola / struktura seskupených řádků
# Zkontroluje strukturu vnořených řádků před vyrovnáním a exportem
sledování_4 = Watch(insert)

# group: Import/export do aplikace Excel > Exportovat do aplikace Excel
# Exportuje strukturovaná data Dynamo do souboru aplikace Excel (.xlsx). Podpora výstupů pro externí kontrolu a integraci s dalšími nástroji
# note: Název exportovaného souboru musí končit na .xlsx
# Pokud soubor se stejným názvem již existuje a možnost Přepsat je nastavena na hodnotu false, export se nezdaří a nový soubor nebude vytvořen.
# Chcete-li nahradit existující soubor, musí být povolena možnost Přepsat.
cesta_k_souboru_4 = Filename("..\..\..\..\..\..\Desktop\Excel_Export_Example.xlsx")
string_2 = StringInput("\"Exportovat výkres\"")
posuvník_celých_čísel_3 = IntegerSlider(0, range=0..100 step 1)
boolean_6 = BoolSelector(true)
openXMLExportExcel = Data.OpenXMLExportExcel(filePath=cesta_k_souboru_4, sheetName=string_2, data=insert, startRow=posuvník_celých_čísel_3, startColumn=posuvník_celých_čísel_3, writeAsString=boolean_6)

# group: Import/export geometrie > Import geometrie
# Importuje geometrii ze souboru SAT do aplikace Dynamo a převede ji na upravitelné křivky, povrchy a tělesa pro pracovní postupy transformace
cesta_k_souboru_5 = Filename("..\..\..\..\..\..\Desktop\Geometry_Import_Example.sat")
soubor_z_cesty = FileObject(path=cesta_k_souboru_5)
jednotky = Units("Metry")
# note: Importuje soubor jako tělesa/povrchy/křivky aplikace Dynamo
importFromSATWithUnits = Geometry.ImportFromSATWithUnits(file_filePath=soubor_z_cesty, dynamoUnit=jednotky)
n3d_sledování_náhled_importované = Watch3D(importFromSATWithUnits)  # "3D sledování (náhled importované geometrie)"

# group: Import/export geometrie > Skupina ladění/výuky
# Zobrazí, co aplikace Dynamo považuje za jednotlivé položky (těleso, povrch, křivku atd.).
# Tato možnost je užitečná, pokud se importované položky chovají neočekávaně.
type = Object.Type(object=importFromSATWithUnits)
sledování_5 = Watch(type)

# group: Import/export geometrie > Transformovat
# Změní měřítko importované geometrie jednotným faktorem
XY = Plane.XY()
blok_kódu_6 = CodeBlock { 5; }
scale = Geometry.Scale(geometry=importFromSATWithUnits, plane=XY, xamount=blok_kódu_6, yamount=blok_kódu_6, zamount=blok_kódu_6)

# group: Import/export geometrie > Export do formátu SAT
# Exportujte aktualizovanou geometrii jako soubor SAT. Soubor SAT lze importovat do aplikace AutoCAD, Revit atd.
cesta_k_souboru_6 = Filename("..\..\..\..\..\..\Desktop\Geometry_Export_Example.sat")
exportToSAT = Geometry.ExportToSAT(geometry=scale, filePath=cesta_k_souboru_6)
n3d_sledování_náhled_geometrie_s = Watch3D(scale)  # "3D sledování (Náhled geometrie s upraveným měřítkem)"
