# Dynamo graph Make a Custom Node.dyn "Vytvořit vlastní uzel" (Dynamo 3.0.3.7597)
# author: Dynamo
# Tento dokument vám pomůže seznámit se s tvorbou vlastního uzlu.

# group: Informace o grafu
# metadata, barevná legenda, pravidla pojmenování
# note: PROJEKT APLIKACE DYNAMO
# Vytvořte vlastní uzel
# note: VERZE APLIKACE DYNAMO
# 4.1.0
# note: VERZE HOSTITELSKÉ APLIKACE
# N/A
# note: ASOCIOVANÉ SOUBORY
# CurveValidate.dyf
# note: POŽADOVANÉ BALÍČKY APLIKACE DYNAMO
# N/A
# note: AUTOR (AUTOŘI) / DATUM VYTVOŘENÍ
# Archilizer for Dynamo Team / 4. února 2026
# note: DALŠÍ KOMENTÁŘE
# Vlastní uzly se obvykle nacházejí v knihovně v části Doplňky.
# Tento vlastní uzel se nachází v umístění:
# Doplňky → Šablony → Křivka → Curve_Validate
# Pokud se nezobrazí:
# Zkontrolujte, zda je soubor .dyf ve složce vlastních uzlů.
# Přejděte na:
# Balíčky → Package Manager → Nastavení balíčku → Vyhledávací cesty balíčku/knihovny
# Ověřte, zda je cesta ke složce uvedena, nebo přidejte novou cestu.
# Po přidání nových vlastních uzlů restartujte aplikaci Dynamo
# note: POPIS
# Tento dokument vám pomůže seznámit se s tvorbou vlastního uzlu.
# Aby byly skripty aplikace Dynamo přehledné a čitelné, doporučujeme dodržovat čistou
# strukturu při tvorbě grafů.
# Další informace o tvorbě vlastních uzlů naleznete na stránce Dynamo Prime o tvorbě vlastních uzlů:
# https://primer2.dynamobim.org/cs/6_custom_nodes_and_packages/6-1_custom-nodes/2-creating

# group: UVNITŘ VLASTNÍHO UZLU
# note: Tento skript kontroluje a filtruje geometrii křivky pomocí jednoduchých pravidel. Přijímá vstupní křivky, například úsečky, oblouky atd., a ověřuje, zda každý objekt existuje, zda je platnou křivkou, zda splňuje volitelnou podmínku otevření nebo uzavření a zda je delší než vybraná minimální délka. Uzel poté předá na výstup platné křivky, neplatné křivky a logickou masku ověření zobrazující, které křivky prošly nebo neprošly kontrolami, což usnadňuje čištění geometrie, zabraňuje chybám v pozdějších krocích a připravuje data pro další zpracování v aplikaci Dynamo.

# group: Kontrola
# LADICÍ A KONTROLNÍ VÝSTUPY SLOUŽÍCÍ K OVĚŘENÍ VÝSLEDKŮ BEZ OVLIVNĚNÍ HLAVNÍCH VÝSTUPŮ.
# note: POUŽITÍ: Kontroly čitelné pro člověka, abyste mohli ověřit, zda graf dělá to, co očekáváte, aniž by se měnily výsledky, například uzly sledování, List.Count, souhrnné řetězce, příznaky „PASS/FAIL“, seznamy chyb, geometrie náhledu (Watch3D) a ukázkové výstupy.

# group: Poznámky
# note: POUŽITÍ:
# PRO KOMENTÁŘE A INFORMACE O SKRIPTU.

# group: Výstupy
# KONEČNÉ VÝSLEDKY VYTVOŘENÉ GRAFEM, PŘIPRAVENÉ K EXPORTU NEBO NÁSLEDNÉMU POUŽITÍ
# note: POUŽITÍ: Konečné výsledky určené k následnému použití (exportované, připojené k jinému grafu), například konečné seznamy, formátované řetězce, vypočtené hodnoty, slovníky/tabulky a data připravená k exportu.

# group: Vstupy
# UŽIVATELEM ŘÍZENÉ HODNOTY, KTERÉ DEFINUJÍ CÍLOVÁ DATA A NASTAVENÍ PŘED TÍM, NEŽ DOJDE K JAKÉMUKOLIV ZPRACOVÁNÍ
# note: POUŽITÍ: Všechny hodnoty řízené uživatelem, které definují, co graf zpracuje a jak by se měl chovat.
# Například posuvníky čísel, řetězce, cesty k souborům, booleovské přepínače, rozevírací seznamy a počáteční seznamy.

# group: Akce
# ZÁKLADNÍ OPERACE, KTERÉ ZPRACOVÁVAJÍ VSTUPY
# note: POUŽITÍ: Hlavní produkční řetězec zpracování, který transformuje vstupy na výsledky. Zde se odehrává „práce“, například čištění seznamu, mapování, filtrování, logika řetězců, operace s geometrií, formátování a převody.

# group: UVNITŘ VLASTNÍHO UZLU > Vstupy
# Pomocí těchto ovládacích prvků definujte, co znamená „platný“.
# Křivky mohou být seznamy úseček, oblouků, objektů PolyCurve nebo smíšených typů křivek.
# Pomocí metody flattenDepth můžete řídit, jak budou zpracovány vnořené seznamy.
číslo = DoubleInput(5)
číslo_2 = DoubleInput(10)
číslo_3 = DoubleInput(15)
byCoordinates = Point.ByCoordinates(x=číslo, y=číslo_2, z=číslo_3)
byCoordinates_2 = Point.ByCoordinates(x=číslo_3, y=číslo, z=číslo_2)
byCoordinates_3 = Point.ByCoordinates(x=číslo_2, y=číslo_3, z=číslo)
tvorba_seznamu = List.Create(item0=byCoordinates, item1=byCoordinates_2, item2=byCoordinates_3)
byPoints = NurbsCurve.ByPoints(points=tvorba_seznamu)
číslo_4 = DoubleInput(1)

# group: UVNITŘ VLASTNÍHO UZLU > Ověření typů a hodnot null
# Před spuštěním kontrol geometrie křivky odfiltruje objekty s hodnotou null a jiné objekty než objekty křivek.
# Tím se zabrání zobrazení upozornění a uzel se stane bezpečnějším pro smíšené vstupy.
flatten = List.Flatten(list=byPoints, amount=číslo_4)
type = Object.Type(object=flatten)
isNull = Object.IsNull(object=flatten)
not_ = Not(x=isNull)

# group: UVNITŘ VLASTNÍHO UZLU > Typ geometrie, která má být zohledněna
# Geometrie podobná křivce
string = StringInput("Úsečka")
boolean = BoolSelector(true)
contains = String.Contains(string=type, searchFor=string, ignoreCase=boolean)
string_2 = StringInput("Křivka")
contains_2 = String.Contains(string=type, searchFor=string_2, ignoreCase=boolean)
string_3 = StringInput("Oblouk")
contains_3 = String.Contains(string=type, searchFor=string_3, ignoreCase=boolean)
string_4 = StringInput("Objekt PolyCurve")
contains_4 = String.Contains(string=type, searchFor=string_4, ignoreCase=boolean)
or_ = Or(bool0=contains, bool1=contains_2, bool2=contains_3, bool3=contains_4)

# group (continued): UVNITŘ VLASTNÍHO UZLU > Ověření typů a hodnot null
and_ = And(bool0=or_, bool1=not_)
filterByBoolMask = List.FilterByBoolMask(list=flatten, mask=and_)

# group: UVNITŘ VLASTNÍHO UZLU > Vstupy
# Pomocí těchto ovládacích prvků definujte, co znamená „platný“.
# minLength je minimální prahová hodnota délky oblouku.
# Nastavte položku requireClosed na hodnotu true, pokud musí být křivky uzavřené (smyčky)
číslo_5 = DoubleInput(5)
boolean_2 = BoolSelector(false)

# group: UVNITŘ VLASTNÍHO UZLU > Kontroly geometrie (délka a uzavření)
# Použije pravidla oblouku:
# délka musí být ≥ minLength
# Pokud je hodnota requireClosed true, křivka musí být uzavřená.
length = Curve.Length(curve=filterByBoolMask.in)
# note: Křivky kratší než MinLength jsou neplatné.
ge = length >= číslo_5
isClosed = Curve.IsClosed(curve=filterByBoolMask.in)
boolean_3 = BoolSelector(true)
if_ = RefactoredIf(test=boolean_2, true=isClosed, false=boolean_3)
and_2 = And(bool0=ge, bool1=if_)

# group: UVNITŘ VLASTNÍHO UZLU > Rozdělit platné a neplatné křivky
# Použije konečnou booleovskou masku k rozdělení křivek do seznamů platných a neplatných.
filterByBoolMask_2 = List.FilterByBoolMask(list=filterByBoolMask.in, mask=and_2)

# group: UVNITŘ VLASTNÍHO UZLU > Výstupy
# validCurves: křivky, které prošly ověřením
# invalidCurves: křivky, u kterých se nezdařilo ověření
# maskValid: booleovská maska k filtrování jinde
blok_kódu = CodeBlock(maskValid=and_2)
# ---------- blok_kódu.designscript (4 lines) ----------
// Boolean mask of validation results
 // true  = valid curve
 // false = invalid curve
 maskValid : bool[]..[];
# ----------------------------------------
blok_kódu_2 = CodeBlock(invalidCurves=filterByBoolMask_2.out)
# ---------- blok_kódu_2.designscript (3 lines) ----------
// Curves that failed validation
 // These should not be used for modelling
 invalidCurves : var[]..[];
# ----------------------------------------
blok_kódu_3 = CodeBlock(validCurves=filterByBoolMask_2.in)
# ---------- blok_kódu_3.designscript (3 lines) ----------
// Curves that passed all validation checks
 // These are safe to use for modelling and automation
 validCurves : var[]..[];
# ----------------------------------------

# group: Vstupy
# Pomocí těchto ovládacích prvků definujte, co znamená „platný“.
# Křivky mohou být seznamy úseček, oblouků, objektů PolyCurve nebo smíšených typů křivek.
# Pomocí metody flattenDepth můžete řídit, jak budou zpracovány vnořené seznamy.
číslo_6 = DoubleInput(5)
boolean_4 = BoolSelector(false)
číslo_7 = DoubleInput(5)
číslo_8 = DoubleInput(10)
číslo_9 = DoubleInput(15)
byCoordinates_4 = Point.ByCoordinates(x=číslo_7, y=číslo_8, z=číslo_9)
byCoordinates_5 = Point.ByCoordinates(x=číslo_9, y=číslo_7, z=číslo_8)
byCoordinates_6 = Point.ByCoordinates(x=číslo_8, y=číslo_9, z=číslo_7)
tvorba_seznamu_2 = List.Create(item0=byCoordinates_4, item1=byCoordinates_5, item2=byCoordinates_6)
byPoints_2 = NurbsCurve.ByPoints(points=tvorba_seznamu_2)
číslo_10 = DoubleInput(1)

# group: VLASTNÍ UZEL
# Dvojitým kliknutím na uzel jej rozbalte a otevřete soubor dyf.
# note: Tato logika je komprimována jako vlastní uzel, aby byla kontrola křivek jednoduchá, opakovaně použitelná a konzistentní v různých grafech aplikace Dynamo. Namísto toho, aby se pokaždé předělávaly stejné kroky ověřování, jsou pravidla obsažena v jednom přehledném nástroji, který lze snadno opakovaně používat, aktualizovat a sdílet. To snižuje výskyt chyb a udržuje grafy čisté a čitelné
curve_Validate = Custom[Curve_Validate](minLength=číslo_6, requireClosed=boolean_4, curveLikeGeometry=byPoints_2, flattenDepth=číslo_10)  # Ověří geometrii křivky kontrolou hodnot null, typu, tolerance délky a volitelného uzavření. Vrátí platné/neplatné křivky, booleovskou masku a důvody selhání.

# group: Výstupy
# Zobrazí platné křivky, neplatné křivky a ověřovací masku.
sledování = Watch(curve_Validate.invalidCurves)
sledování_2 = Watch(curve_Validate.validCurves)
sledování_3 = Watch(curve_Validate.maskValid)
