# Dynamo graph Create a Graph.dyn "Diagramm erstellen" (Dynamo 4.0.0.3076)
# author: Dynamo
# Dieses Dokument hilft Ihnen, sich mit einem standardisierten Arbeitsablauf und den folgenden wichtigen Schritten vertraut zu machen.

# group: SO ERSTELLEN SIE EIN DYNAMO-DIAGRAMM > Beispiel
# note: Namensgenerator

# group: Benennungsstandards für Gruppen Eingaben → Aktion → Ausgaben → Überprüfung > Eingaben
# BENUTZERGESTEUERTE WERTE, DIE DIE ZIELDATEN UND EINSTELLUNGEN DEFINIEREN, BEVOR EINE VERARBEITUNG STATTFINDET
# note: VERWENDUNG: Alle vom Benutzer gesteuerten Werte, die definieren, was das Diagramm verarbeitet und wie es sich verhalten soll,
# z. B. Zahlen-Schieberegler, Zeichenfolgen, Dateipfade, boolesche Umschalter, Dropdown-Listen und anfängliche Listen.

# group: Benennungsstandards für Gruppen Eingaben → Aktion → Ausgaben → Überprüfung > Aktionen
# KERNVORGÄNGE, DIE DIE EINGABEN VERARBEITEN
# note: VERWENDUNG: Hauptverarbeitungs-Pipeline, die Eingaben in Ergebnisse umwandelt. Hier findet die eigentliche Arbeit statt, z. B. Listenbereinigung, Zuordnung, Filterung, Zeichenfolgenlogik, Geometrievorgänge, Formatierung, Konvertierungen.

# group: Benennungsstandards für Gruppen Eingaben → Aktion → Ausgaben → Überprüfung > Ausgaben
# VOM DIAGRAMM ERZEUGTE ENDERGEBNISSE, BEREIT FÜR DEN EXPORT ODER DIE NACHFOLGENDE VERWENDUNG
# note: VERWENDUNG: Endergebnisse, die nachfolgend verwendet werden sollen (exportieren, in ein anderes Diagramm einfügen), z. B. endgültige Listen, formatierte Zeichenfolgen, berechnete Werte, Wörterbücher/Tabellen, exportfähige Daten

# group: Benennungsstandards für Gruppen Eingaben → Aktion → Ausgaben → Überprüfung > Überprüfung
# FEHLERSUCHE- UND PRÜFAUSGABEN, DIE ZUR ÜBERPRÜFUNG DER ERGEBNISSE OHNE BEEINTRÄCHTIGUNG DER HAUPTAUSGABEN VERWENDET WERDEN
# note: VERWENDUNG: Von Menschen lesbare Prüfungen, mit denen Sie überprüfen können, ob das Diagramm die erwarteten Funktionen erfüllt, ohne Ergebnisse zu ändern, z. B. Watch-Blöcke, List.Count, Zusammenfassungszeichenfolgen, PASS-/FAIL-Flags, Fehlerlisten, Geometrievorschau (Watch3D), Beispielausgaben.

# group: Benennungsstandards für Gruppen Eingaben → Aktion → Ausgaben → Überprüfung > Beschriftungen
# note: VERWENDUNG:
# FÜR KOMMENTARE UND SKRIPTINFORMATIONEN

# group: Diagramminformationen
# Metadaten, Farbcodelegende, Benennungsregeln
# note: DYNAMO-PROJEKT
# Diagramm erstellen
# note: DYNAMO-VERSION
# 4.1.0
# note: VERSION DER HOST-ANWENDUNG
# n. z.
# note: VERKNÜPFTE DATEI(EN)
# n. z.
# note: ERFORDERLICHE DYNAMO-PAKETE
# n. z.
# note: AUTOR(EN)/ERSTELLUNGSDATUM
# Archilizer for Dynamo Team/Feb. 4 2026
# note: ZUSÄTZLICHE KOMMENTARE
# n. z.
# note: BESCHREIBUNG
# Dieses Dokument hilft Ihnen, sich mit einem standardisierten Arbeitsablauf und den folgenden wichtigen Schritten vertraut zu machen

# group: SO ERSTELLEN SIE EIN DYNAMO-DIAGRAMM > Diagramminformationen
# Metadaten, Farbcodelegende, Benennungsregeln
# note: DYNAMO-PROJEKT
# Siehe Benennungsstandards für Diagrammdateien
# note: DYNAMO-VERSION
# note: VERSION DER HOST-ANWENDUNG
# note: VERKNÜPFTE DATEI(EN)
# note: ERFORDERLICHE DYNAMO-PAKETE
# note: AUTOR(EN)/ERSTELLUNGSDATUM
# note: ZUSÄTZLICHE KOMMENTARE
# note: BESCHREIBUNG
# In der Diagrammbeschreibung sollte angegeben werden,
# was das Diagramm tut, welche Daten verwendet werden,
# welche Regeln angewendet werden, was ausgegeben wird,
# wo und wie es ausgeführt wird (Host-App + Version) sowie alle wichtigen Einschränkungen

# group: SO ERSTELLEN SIE EIN DYNAMO-DIAGRAMM > Dynamo Player Eingaben → Aktionen → Ausgaben
# Dynamo Player ermöglicht die Ausführung von Dynamo-Diagrammen, ohne die Dynamo-Benutzeroberfläche zu öffnen.
# Benutzer interagieren nur mit vordefinierten Eingaben und führen das Skript aus
# note: Klicken Sie mit der rechten Maustaste auf den Eingabeknoten, und wählen Sie Ist Eingabe aus
ihre_eingabe = StringInput("Dynamo Player")  # graph input
ihre_aktion = String.ToUpper(string=ihre_eingabe)
# note: Klicken Sie mit der rechten Maustaste auf den Eingabeknoten, und wählen Sie Ist Ausgabe aus
ihre_ausgabe = Watch(ihre_aktion)  # graph output

# group: SO ERSTELLEN SIE EIN DYNAMO-DIAGRAMM > Blockbenennungsstandards
# note: Ändern Sie nicht den gesamten Knotennamen. Verwenden Sie stattdessen Klammern am Ende.
zeichenfolge = StringInput("")
# note: AUSFÜHREN
zeichenfolge_eingabe_1 = StringInput("")
# note: NICHT AUSFÜHREN
# note: Diese Regeln entsprechend Ihren Bürostandards aktualisieren
eingabe_1 = StringInput("")
typische_gebote_und_verbote = CodeBlock()
# ---------- typische_gebote_und_verbote.designscript (12 lines) ----------
/*
Do:
Rename key nodes only (inputs, rules, outputs, decision logic)
Use notes to add context to your script
Use capitalization consistently (e.g. Title Case or camelCase, not mixed)
*/

/*Do Not:
Rename every node in the graph
Leave important nodes with default names if they affect logic
Use vague names like "Data", "Stuff", "Fix", "Test"
*/;
# ----------------------------------------

# group: SO ERSTELLEN SIE EIN DYNAMO-DIAGRAMM > Benennungsstandards für Diagrammdateien
# Um den Zweck oder die beabsichtigte Verwendung eines Diagramms anhand seines Namens zu verstehen, empfehlen wir, einem Benennungsmuster zu folgen, das der Konvention des BIM-Ausführungsplans ähnelt:
zeichenfolge_2 = StringInput("-")
organisation = CodeBlock { "AUT"; }
funktionsfelder = CodeBlock { BLD  = "BLD"; STR  = "STR"; MEP  = "MEP"; INFR = "INFR"; }
beschreibung = CodeBlock { "Logical_description"; }
dynamo_version = CodeBlock { "D303"; }
skript_version_nur_für = CodeBlock { "V2"; }  # "Skript-Version (nur für Sicherungsdateien)"
assembly_reihenfolge = String.Join(separator=zeichenfolge_2, string0=organisation, string1=funktionsfelder.BLD, string2=beschreibung, string3=dynamo_version, string4=skript_version_nur_für)
namensbeispiel = Watch(assembly_reihenfolge)
# note: Empfohlene Benennungsstruktur
benennungsstruktur = CodeBlock()
# ---------- benennungsstruktur.designscript (3 lines) ----------
["Organisation  | Function fields | Description         | Dynamo-Version | Script-Version",
"AUT            |BLD              | Logical_description | D303           | V3"
];
# ----------------------------------------
# note: NICHT BEARBEITEN:
# note: Funktionsfelder beschreiben den Hauptarbeitsbereich/die Hauptdomäne des Skripts
funktionsfelder_2 = CodeBlock()
# ---------- funktionsfelder_2.designscript (4 lines) ----------
BLD  = "BLD  — Building design";
STR  = "STR  — Structural design";
MEP  = "MEP  — Mechanical / Electrical / Plumbing";
INFR = "INFR — Infrastructure";
# ----------------------------------------

# group: SO ERSTELLEN SIE EIN DYNAMO-DIAGRAMM
# Visueller Leitfaden zu Struktur, Benennung und optimale Verfahren
# note: Watch-Blöcke nur an wichtigen Prüfpunkten verwenden
# Nicht aktives Skript einfrieren
# note: Vor dem Ausführen eines Diagramms:
# Prüfen Sie, ob Eingaben festgelegt sind
# Überprüfen Sie die Vorschau/Prüfungen
# Führen Sie das Diagramm einmal manuell aus, bevor Sie Dynamo Player verwenden
# Speichern Sie die Datei nach erfolgreicher Ausführung
# note: Dieses Dokument hilft Ihnen, sich mit einem standardisierten Arbeitsablauf und den folgenden wichtigen Schritten vertraut zu machen
# note: Hintergrund/Rückseite
informationen = CodeBlock()
# ---------- informationen.designscript (5 lines) ----------
"To keep Dynamo graphs neat and readable, we recommend following a clear
structure.

For more information, read the Dynamo Primer page on best-practice graph strategies:
https://primer2.dynamobim.org/9_best_practices/1-graph-strategies";
# ----------------------------------------
