# Dynamo graph Make a Custom Node.dyn "Benutzerdefinierten Block erstellen" (Dynamo 3.0.3.7597)
# author: Dynamo
# Dieses Dokument hilft Ihnen, sich mit der Erstellung von benutzerdefinierten Blöcken vertraut zu machen.

# group: Diagramminformationen
# Metadaten, Farbcodelegende, Benennungsregeln
# note: DYNAMO-PROJEKT
# Benutzerdefinierten Block erstellen
# note: DYNAMO-VERSION
# 4.1.0
# note: VERSION DER HOST-ANWENDUNG
# n. z.
# note: VERKNÜPFTE DATEI(EN)
# Curve_Validate.dyf
# note: ERFORDERLICHE DYNAMO-PAKETE
# n. z.
# note: AUTOR(EN)/ERSTELLUNGSDATUM
# Archilizer for Dynamo Team/Feb. 4 2026
# note: ZUSÄTZLICHE KOMMENTARE
# Benutzerdefinierte Blöcke befinden sich in der Regel im Abschnitt Add-Ons der Bibliothek.
# Dieser benutzerdefinierte Block befindet sich unter:
# Add-Ons → Vorlagen → Kurve → Curve_Validate
# Wenn er nicht angezeigt wird:
# Überprüfen Sie, ob sich die DYF-Datei in Ihrem Ordner für benutzerdefinierte Blöcke befindet
# Navigieren Sie zu:
# Pakete → Package Manager → Paketeinstellungen → Paket-/Bibliothekssuchpfade
# Stellen Sie sicher, dass der Ordnerpfad aufgeführt ist, oder fügen Sie einen neuen Pfad hinzu
# Starten Sie Dynamo nach dem Hinzufügen neuer benutzerdefinierter Blöcke neu
# note: BESCHREIBUNG
# Dieses Dokument hilft Ihnen, sich mit der Erstellung von benutzerdefinierten Blöcken vertraut zu machen.
# Damit die Diagramme in Dynamo übersichtlich und lesbar bleiben, empfehlen wir, beim
# Erstellen von Diagrammen eine klare Struktur zu verwenden.
# Weitere Informationen zum Erstellen von benutzerdefinierten Blöcken finden Sie auf der folgenden Dynamo Primer-Seite:
# https://primer2.dynamobim.org/de/6_custom_nodes_and_packages/6-1_custom-nodes/2-creating

# group: INNERHALB IHRES BENUTZERDEFINIERTEN BLOCKS
# note: Dieses Skript überprüft und filtert die Kurvengeometrie anhand einfacher Regeln. Es überprüft anhand von Eingabekurven wie Linien, Bogen usw., ob die einzelnen Objekte existieren, ob es sich um eine gültige Kurve handelt, ob eine optionale Offen- oder Geschlossen-Bedingung erfüllt ist und ob die Objekte länger als die ausgewählte Mindestlänge sind. Der Block gibt dann gültige Kurven, ungültige Kurven und eine boolesche Validierungsmaske aus, die anzeigt, welche Kurven die Prüfungen bestanden bzw. nicht bestanden haben. Dies erleichtert die Bereinigung der Geometrie, die Vermeidung von Fehlern in späteren Schritten und die Vorbereitung der Daten für die weitere Verarbeitung in Dynamo.

# group: Überprüfung
# FEHLERSUCHE- UND PRÜFAUSGABEN, DIE ZUR ÜBERPRÜFUNG DER ERGEBNISSE OHNE BEEINTRÄCHTIGUNG DER HAUPTAUSGABEN VERWENDET WERDEN
# note: VERWENDUNG: Von Menschen lesbare Prüfungen, mit denen Sie überprüfen können, ob das Diagramm die erwarteten Funktionen erfüllt, ohne Ergebnisse zu ändern, z. B. Watch-Blöcke, List.Count, Zusammenfassungszeichenfolgen, PASS-/FAIL-Flags, Fehlerlisten, Geometrievorschau (Watch3D) und Beispielausgaben.

# group: Beschriftungen
# note: VERWENDUNG:
# FÜR KOMMENTARE UND SKRIPTINFORMATIONEN.

# group: Ausgaben
# VOM DIAGRAMM ERZEUGTE ENDERGEBNISSE, BEREIT FÜR DEN EXPORT ODER DIE NACHFOLGENDE VERWENDUNG
# note: VERWENDUNG: Endergebnisse, die nachfolgend verwendet werden sollen (exportieren, in ein anderes Diagramm einfügen), z. B. endgültige Listen, formatierte Zeichenfolgen, berechnete Werte, Wörterbücher/Tabellen und exportfähige Daten.

# group: Eingaben
# BENUTZERGESTEUERTE WERTE, DIE DIE ZIELDATEN UND EINSTELLUNGEN DEFINIEREN, BEVOR EINE VERARBEITUNG STATTFINDET
# note: VERWENDUNG: Alle vom Benutzer gesteuerten Werte, die definieren, was das Diagramm verarbeitet und wie es sich verhalten soll,
# z. B. Zahlen-Schieberegler, Zeichenfolgen, Dateipfade, boolesche Umschalter, Dropdown-Listen und anfängliche Listen.

# group: Aktionen
# KERNVORGÄNGE, DIE DIE EINGABEN VERARBEITEN
# note: VERWENDUNG: Hauptverarbeitungs-Pipeline, die Eingaben in Ergebnisse umwandelt. Hier findet die eigentliche Arbeit statt, z. B. Listenbereinigung, Zuordnung, Filterung, Zeichenfolgenlogik, Geometrievorgänge, Formatierung und Konvertierungen.

# group: INNERHALB IHRES BENUTZERDEFINIERTEN BLOCKS > Eingaben
# Verwenden Sie diese Steuerelemente, um zu definieren, was Gültig bedeutet.
# Kurven können eine Liste von Linien, Bogen, PolyCurves oder gemischten Kurventypen sein.
# Verwenden Sie flattenDepth, um zu steuern, wie verschachtelte Listen behandelt werden.
nummer = DoubleInput(5)
nummer_2 = DoubleInput(10)
nummer_3 = DoubleInput(15)
byCoordinates = Point.ByCoordinates(x=nummer, y=nummer_2, z=nummer_3)
byCoordinates_2 = Point.ByCoordinates(x=nummer_3, y=nummer, z=nummer_2)
byCoordinates_3 = Point.ByCoordinates(x=nummer_2, y=nummer_3, z=nummer)
list_create = List.Create(item0=byCoordinates, item1=byCoordinates_2, item2=byCoordinates_3)
byPoints = NurbsCurve.ByPoints(points=list_create)
nummer_4 = DoubleInput(1)

# group: INNERHALB IHRES BENUTZERDEFINIERTEN BLOCKS > Null- und Typvalidierung
# Filtert Nullen und Objekte ohne Kurven heraus, bevor Kurvengeometrieprüfungen durchgeführt werden.
# Dadurch werden Warnungen verhindert, und der Block wird für gemischte Eingaben sicherer.
flatten = List.Flatten(list=byPoints, amount=nummer_4)
type = Object.Type(object=flatten)
isNull = Object.IsNull(object=flatten)
not_ = Not(x=isNull)

# group: INNERHALB IHRES BENUTZERDEFINIERTEN BLOCKS > Zu berücksichtigender Geometrietyp
# Kurvenartige Geometrie
zeichenfolge = StringInput("Line")
boolesch = BoolSelector(true)
contains = String.Contains(string=type, searchFor=zeichenfolge, ignoreCase=boolesch)
zeichenfolge_2 = StringInput("Curve")
contains_2 = String.Contains(string=type, searchFor=zeichenfolge_2, ignoreCase=boolesch)
zeichenfolge_3 = StringInput("Arc")
contains_3 = String.Contains(string=type, searchFor=zeichenfolge_3, ignoreCase=boolesch)
zeichenfolge_4 = StringInput("PolyCurve")
contains_4 = String.Contains(string=type, searchFor=zeichenfolge_4, ignoreCase=boolesch)
or_ = Or(bool0=contains, bool1=contains_2, bool2=contains_3, bool3=contains_4)

# group (continued): INNERHALB IHRES BENUTZERDEFINIERTEN BLOCKS > Null- und Typvalidierung
and_ = And(bool0=or_, bool1=not_)
filterByBoolMask = List.FilterByBoolMask(list=flatten, mask=and_)

# group: INNERHALB IHRES BENUTZERDEFINIERTEN BLOCKS > Eingaben
# Verwenden Sie diese Steuerelemente, um zu definieren, was Gültig bedeutet.
# minLength ist ein Grenzwert für die minimale Kurvenlänge.
# Setzen Sie requireClosed auf true, wenn Kurven geschlossen sein müssen (Schleifen)
nummer_5 = DoubleInput(5)
boolesch_2 = BoolSelector(false)

# group: INNERHALB IHRES BENUTZERDEFINIERTEN BLOCKS > Geometrieprüfungen (Länge und Abschluss)
# Wendet Kurvenregeln an:
# Länge muss ≥ minLength sein
# Wenn requireClosed true lautet, muss die Kurve geschlossen sein
length = Curve.Length(curve=filterByBoolMask.in)
# note: Kurven, die kürzer als MinLength sind, sind ungültig.
ge = length >= nummer_5
isClosed = Curve.IsClosed(curve=filterByBoolMask.in)
boolesch_3 = BoolSelector(true)
if_ = RefactoredIf(test=boolesch_2, true=isClosed, false=boolesch_3)
and_2 = And(bool0=ge, bool1=if_)

# group: INNERHALB IHRES BENUTZERDEFINIERTEN BLOCKS > Gültige und ungültige Kurven unterteilen
# Verwendet die letzte boolesche Maske, um Kurven in gültige und ungültige Listen zu unterteilen.
filterByBoolMask_2 = List.FilterByBoolMask(list=filterByBoolMask.in, mask=and_2)

# group: INNERHALB IHRES BENUTZERDEFINIERTEN BLOCKS > Ausgaben
# validCurves: Kurven, die die Validierung bestanden haben
# invalidCurves: Kurven, deren Validierung fehlgeschlagen ist
# maskValid: Boolesche Maske zum Filtern an anderer Stelle
codeblock = CodeBlock(maskValid=and_2)
# ---------- codeblock.designscript (4 lines) ----------
// Boolean mask of validation results
 // true  = valid curve
 // false = invalid curve
 maskValid : bool[]..[];
# ----------------------------------------
codeblock_2 = CodeBlock(invalidCurves=filterByBoolMask_2.out)
# ---------- codeblock_2.designscript (3 lines) ----------
// Curves that failed validation
 // These should not be used for modelling
 invalidCurves : var[]..[];
# ----------------------------------------
codeblock_3 = CodeBlock(validCurves=filterByBoolMask_2.in)
# ---------- codeblock_3.designscript (3 lines) ----------
// Curves that passed all validation checks
 // These are safe to use for modelling and automation
 validCurves : var[]..[];
# ----------------------------------------

# group: Eingaben
# Verwenden Sie diese Steuerelemente, um zu definieren, was Gültig bedeutet.
# Kurven können eine Liste von Linien, Bogen, PolyCurves oder gemischten Kurventypen sein.
# Verwenden Sie flattenDepth, um zu steuern, wie verschachtelte Listen behandelt werden
nummer_6 = DoubleInput(5)
boolesch_4 = BoolSelector(false)
nummer_7 = DoubleInput(5)
nummer_8 = DoubleInput(10)
nummer_9 = DoubleInput(15)
byCoordinates_4 = Point.ByCoordinates(x=nummer_7, y=nummer_8, z=nummer_9)
byCoordinates_5 = Point.ByCoordinates(x=nummer_9, y=nummer_7, z=nummer_8)
byCoordinates_6 = Point.ByCoordinates(x=nummer_8, y=nummer_9, z=nummer_7)
list_create_2 = List.Create(item0=byCoordinates_4, item1=byCoordinates_5, item2=byCoordinates_6)
byPoints_2 = NurbsCurve.ByPoints(points=list_create_2)
nummer_10 = DoubleInput(1)

# group: BENUTZERDEFINIERTER BLOCK
# Doppelklicken Sie auf den Block, um ihn zu erweitern und die DYF-Datei zu öffnen.
# note: Diese Logik ist als benutzerdefinierter Block komprimiert, um die Kurvenprüfung einfach, wiederverwendbar und konsistent über verschiedene Dynamo-Diagramme hinweg zu gestalten. Anstatt jedes Mal die gleichen Validierungsschritte neu zu erstellen, sind die Regeln in einem übersichtlichen Werkzeug enthalten, das einfach wiederverwendet, aktualisiert und freigegeben werden kann. Dadurch werden Fehler reduziert sowie Diagramme klar strukturiert und lesbar gehalten
curve_Validate = Custom[Curve_Validate](minLength=nummer_6, requireClosed=boolesch_4, curveLikeGeometry=byPoints_2, flattenDepth=nummer_10)  # Validiert die Kurvengeometrie durch Überprüfen von Nullwerten, Typ, Längentoleranz und optionalem Abschluss. Gibt gültige/ungültige Kurven, boolesche Masken und Fehlerursachen zurück.

# group: Ausgaben
# Zeigt gültige Kurven, ungültige Kurven und die Validierungsmaske an.
watch = Watch(curve_Validate.invalidCurves)
watch_2 = Watch(curve_Validate.validCurves)
watch_3 = Watch(curve_Validate.maskValid)
