# Dynamo graph Template_00_HowToCreateADynamoGraph.dyn (Dynamo 4.0.0.3076)
# author: Dynamo
# This document will help you get familiarised with a standardised workflow and the following important steps.

# group: HOW TO CREATE A DYNAMO GRAPH > Beispiel
# note: Name generator

# group: Group Naming Standards Inputs → Action → Outputs → Review > Eingaben
# USER-CONTROLLED VALUES THAT DEFINE THE TARGET DATA AND SETTINGS BEFORE ANY PROCESSING OCCURS
# note: USE: All user-controlled values that define what the graph will process and how it should behave.
# such as number sliders, strings, file paths, Boolean toggles, dropdowns, initial lists.

# group: Group Naming Standards Inputs → Action → Outputs → Review > Aktionen
# CORE OPERATIONS THAT PROCESS THE INPUTS
# note: USE: The main processing pipeline that transforms inputs into results. This is where the “work” happens such as list cleaning, mapping, filtering, string logic, geometry operations, formatting, conversions.

# group: Group Naming Standards Inputs → Action → Outputs → Review > Ausgaben
# FINAL RESULTS PRODUCED BY THE GRAPH, READY FOR EXPORT OR DOWNSTREAM USE
# note: USE: Final results intended to be used downstream (exported, plugged into another graph) such as final lists, formatted strings, calculated values, dictionaries/tables, export-ready data

# group: Group Naming Standards Inputs → Action → Outputs → Review > Überprüfung
# DEBUG AND CHECK OUTPUTS, USED TO VERIFY RESULTS WITHOUT AFFECTING THE MAIN OUTPUTS
# note: USE : Human-readable checks so you can verify the graph is doing what you expect, without changing results such as watch nodes, List.Count, summary strings, “PASS/FAIL” flags, error lists, preview geometry (Watch3D), sample outputs.

# group: Group Naming Standards Inputs → Action → Outputs → Review > Beschriftungen
# note: USE:
# FOR COMMENTS AND SCRIPT INFO

# group: Graph Information
# metadata, colour code legend, naming rules
# note: DYNAMO PROJECT
# Template_00_HowToCreateADynamoGraph
# note: DYNAMO VERSION
# 4.1.0
# note: HOST APPLICATION VERSION
# N/A
# note: ASSOCIATED FILE(S)
# N/A
# note: REQUIRED DYNAMO PACKAGES
# N/A
# note: AUTHOR(S) / CREATION DATE
# Archilizer for Dynamo Team / Feb. 4 2026
# note: ADDITIONAL COMMENTS
# N/A
# note: DESCRIPTION
# This document will help you get familiarised with a standardised workflow and the following important steps

# group: HOW TO CREATE A DYNAMO GRAPH > Graph Information
# metadata, colour code legend, naming rules
# note: DYNAMO PROJECT
# See Graph File Naming Standards
# note: DYNAMO VERSION
# note: HOST APPLICATION VERSION
# note: ASSOCIATED FILE(S)
# note: REQUIRED DYNAMO PACKAGES
# note: AUTHOR(S) / CREATION DATE
# note: ADDITIONAL COMMENTS
# note: DESCRIPTION
# Graph description should state
# what the graph does,  what data it uses,
# what rules it applies, what it outputs,
# where and how it runs (host app + version) and any key limits

# group: HOW TO CREATE A DYNAMO GRAPH > Dynamo Player Inputs → Actions → Outputs
# Dynamo Player allows Dynamo graphs to be run without opening the Dynamo interface.
# Users interact only with predefined inputs and run the script
# note: Right click on your input node and select "Is Input"
your_input = StringInput("Dynamo player")  # graph input
your_action = String.ToUpper(string=your_input)
# note: Right click on your input node and select "Is Output"
your_output = Watch(your_action)  # graph output

# group: HOW TO CREATE A DYNAMO GRAPH > Node Naming Standards
# note: Do not change the entire node name. Instead, use parentheses at the end.
string = StringInput("")
# note: DO
string_input_1 = StringInput("")
# note: DO NOT DO
# note: Update these rules based on your office standards
eingang_1 = StringInput("")
typical_do_do_not_rules = CodeBlock()
# ---------- typical_do_do_not_rules.designscript (12 lines) ----------
/*
Do:
Rename key nodes only (inputs, rules, outputs, decision logic)
Use notes to add context to your script
Use capitalization consistently (e.g. Title Case or camelCase, not mixed)
*/

/*Do Not:
Rename every node in the graph
Leave important nodes with default names if they affect logic
Use vague names like "Data", "Stuff", "Fix", "Test"
*/;
# ----------------------------------------

# group: HOW TO CREATE A DYNAMO GRAPH > Graph File Naming Standards
# In order to understand the purpose or intended usage of a graph by its name we suggest to follow a naming pattern similar to the convention of BIM execution plan :
string_2 = StringInput("-")
organisation = CodeBlock { "AUT"; }
function_fields = CodeBlock { BLD  = "BLD"; STR  = "STR"; MEP  = "MEP"; INFR = "INFR"; }
beschreibung = CodeBlock { "Logical_description"; }
dynamo_version = CodeBlock { "D303"; }
script_version_only_for_backup = CodeBlock { "V2"; }  # "Script-Version (only for backup files)"
assembly_order = String.Join(separator=string_2, string0=organisation, string1=function_fields.BLD, string2=beschreibung, string3=dynamo_version, string4=script_version_only_for_backup)
name_example = Watch(assembly_order)
# note: Recommended naming structure
naming_structure = CodeBlock()
# ---------- naming_structure.designscript (3 lines) ----------
["Organisation  | Function fields | Description         | Dynamo-Version | Script-Version",
"AUT            |BLD              | Logical_description | D303           | V3"
];
# ----------------------------------------
# note: DO NOT EDIT :
# note: Function fields describe the main working area/ domain of the script
function_fields_2 = CodeBlock()
# ---------- function_fields_2.designscript (4 lines) ----------
BLD  = "BLD  — Building design";
STR  = "STR  — Structural design";
MEP  = "MEP  — Mechanical / Electrical / Plumbing";
INFR = "INFR — Infrastructure";
# ----------------------------------------

# group: HOW TO CREATE A DYNAMO GRAPH
# A visual guide to structure, naming and best practice
# note: Use Watch nodes only at key checkpoints
# Freeze non-active script
# note: Before running a graph :
# Check Inputs are set
# Review Preview/Checks
# Run once manually before using Dynamo Player
# Save the file after successful run
# note: This document will help you get familiarized with a standardised workflow and the following important steps
# note: Background/ back panel
informationen = CodeBlock()
# ---------- informationen.designscript (5 lines) ----------
"To keep Dynamo graphs neat and readable, we recommend following a clear
structure.

For more information, read the Dynamo Primer page on best-practice graph strategies:
https://primer2.dynamobim.org/9_best_practices/1-graph-strategies";
# ----------------------------------------
