# Dynamo graph Create a Graph.dyn "Crear un gráfico" (Dynamo 4.0.0.3076)
# author: Dynamo
# Este documento le ayudará a familiarizarse con un flujo de trabajo estandarizado y con los siguientes pasos importantes.

# group: CÓMO CREAR UN GRÁFICO DE DYNAMO > Ejemplo
# note: Generador de nombres

# group: Normas de nomenclatura de grupos Entradas → Acción → Salidas → Revisión > Entradas
# VALORES CONTROLADOS POR EL USUARIO QUE DEFINEN LOS DATOS Y LA CONFIGURACIÓN DE DESTINO ANTES DE QUE SE PRODUZCA NINGÚN PROCESAMIENTO
# note: USO: Todos los valores controlados por el usuario que definen lo que el gráfico procesará y cómo debe comportarse.
# Por ejemplo, controles deslizantes de número, cadenas, rutas de archivo, conmutadores booleanos, menús desplegables y listas iniciales.

# group: Normas de nomenclatura de grupos Entradas → Acción → Salidas → Revisión > Acciones
# OPERACIONES PRINCIPALES QUE PROCESAN LAS ENTRADAS
# note: USO: El canal de procesamiento principal que transforma las entradas en resultados. Aquí es donde se produce el "trabajo", como la limpieza de listas, la asignación, el filtrado, la lógica de cadenas, las operaciones de geometría, la aplicación de formato y las conversiones.

# group: Normas de nomenclatura de grupos Entradas → Acción → Salidas → Revisión > Salidas
# RESULTADOS FINALES GENERADOS POR EL GRÁFICO, LISTOS PARA LA EXPORTACIÓN O EL USO POSTERIOR
# note: USO: Resultados finales que se van a utilizar en fases posteriores (exportados o conectados a otro gráfico), como listas finales, cadenas con formato, valores calculados, diccionarios/tablas, datos listos para la exportación

# group: Normas de nomenclatura de grupos Entradas → Acción → Salidas → Revisión > Revisar
# DEPURA Y COMPRUEBA LAS SALIDAS, QUE SE UTILIZAN PARA VERIFICAR LOS RESULTADOS SIN QUE ELLO AFECTE A LAS SALIDAS PRINCIPALES
# note: USO: Comprobaciones de lectura humana para que pueda comprobar que el gráfico funciona según lo previsto, sin cambiar resultados como los nodos Watch, List.Count, cadenas de resumen, indicadores "PASS/FAIL", listas de errores, geometría de vista previa (Watch3D) y salidas de ejemplo.

# group: Normas de nomenclatura de grupos Entradas → Acción → Salidas → Revisión > Anotaciones
# note: USO:
# PARA COMENTARIOS E INFORMACIÓN DE LA SECUENCIA DE COMANDOS

# group: Información del gráfico
# metadatos, leyenda de código de color, reglas de asignación de nombres
# note: PROYECTO DE DYNAMO
# Crear un gráfico
# note: VERSIÓN DE DYNAMO
# 4.2.0
# note: VERSIÓN DE LA APLICACIÓN HOST
# N/D
# note: ARCHIVO(S) ASOCIADO(S)
# N/D
# note: PAQUETES DE DYNAMO NECESARIOS
# N/D
# note: AUTOR(ES)/FECHA DE CREACIÓN
# Archilizer for Dynamo Team/4 de febrero de 2026
# note: COMENTARIOS ADICIONALES
# N/D
# note: DESCRIPCIÓN
# Este documento le ayudará a familiarizarse con un flujo de trabajo estandarizado y con los siguientes pasos importantes.

# group: CÓMO CREAR UN GRÁFICO DE DYNAMO > Información del gráfico
# metadatos, leyenda de código de color, reglas de asignación de nombres
# note: PROYECTO DE DYNAMO
# Consulte Normas de nomenclatura de archivos de gráficos.
# note: VERSIÓN DE DYNAMO
# note: VERSIÓN DE LA APLICACIÓN HOST
# note: ARCHIVO(S) ASOCIADO(S)
# note: PAQUETES DE DYNAMO NECESARIOS
# note: AUTOR(ES)/FECHA DE CREACIÓN
# note: COMENTARIOS ADICIONALES
# note: DESCRIPCIÓN
# La descripción del gráfico debe indicar
# qué hace el gráfico, qué datos usa,
# qué reglas aplica, qué salida,
# dónde y cómo se ejecuta (aplicación host + versión) y los límites de claves.

# group: CÓMO CREAR UN GRÁFICO DE DYNAMO > Reproductor de Dynamo Entradas → Acciones → Salidas
# El Reproductor de Dynamo permite ejecutar gráficos de Dynamo sin abrir la interfaz de Dynamo.
# Los usuarios interactúan solo con entradas predefinidas y ejecutan la secuencia de comandos.
# note: Haga clic con el botón derecho en el nodo de entrada y seleccione "Es entrada".
su_entrada = StringInput("Reproductor de Dynamo")  # graph input
su_acción = String.ToUpper(cadena=su_entrada)
# note: Haga clic con el botón derecho en el nodo de entrada y seleccione "Es salida".
salida = Watch(su_acción)  # graph output

# group: CÓMO CREAR UN GRÁFICO DE DYNAMO > Normas de nomenclatura de nodos
# note: No cambie el nombre completo del nodo. En su lugar, utilice un paréntesis al final.
cadena = StringInput("")
# note: HACER
cadena_entrada_1 = StringInput("")
# note: NO HACER
# note: Actualice estas reglas en función de las normas de su oficina.
entrada_1 = StringInput("")
reglas_típicas_de_hacer_no_hacer = CodeBlock()
# ---------- reglas_típicas_de_hacer_no_hacer.designscript (12 lines) ----------
/*
Do:
Rename key nodes only (inputs, rules, outputs, decision logic)
Use notes to add context to your script
Use capitalization consistently (e.g. Title Case or camelCase, not mixed)
*/

/*Do Not:
Rename every node in the graph
Leave important nodes with default names if they affect logic
Use vague names like "Data", "Stuff", "Fix", "Test"
*/;
# ----------------------------------------

# group: CÓMO CREAR UN GRÁFICO DE DYNAMO > Normas de nomenclatura de archivos de gráficos
# Para comprender la finalidad o el uso previsto de un gráfico por su nombre, sugerimos seguir un patrón de nomenclatura similar al de la convención del plan de ejecución de BIM:
cadena_2 = StringInput("-")
organización = CodeBlock { "AUT"; }
campos_de_función = CodeBlock { BLD  = "BLD"; STR  = "STR"; MEP  = "MEP"; INFR = "INFR"; }
descripción = CodeBlock { "Logical_description"; }
versión_de_dynamo = CodeBlock { "D303"; }
versión_de_la_secuencia_de = CodeBlock { "V2"; }  # "Versión de la secuencia de comandos (solo para archivos de copia de seguridad)"
orden_de_montaje = String.Join(separador=cadena_2, cadena0=organización, cadena1=campos_de_función.BLD, cadena2=descripción, cadena3=versión_de_dynamo, cadena4=versión_de_la_secuencia_de)
ejemplo_de_nombre = Watch(orden_de_montaje)
# note: Estructura de nomenclatura recomendada
estructura_de_nomenclatura = CodeBlock()
# ---------- estructura_de_nomenclatura.designscript (3 lines) ----------
["Organisation  | Function fields | Description         | Dynamo-Version | Script-Version",
"AUT            |BLD              | Logical_description | D303           | V3"
];
# ----------------------------------------
# note: NO EDITAR:
# note: Los campos de función describen el área de trabajo principal/dominio de la secuencia de comandos.
campos_de_función_2 = CodeBlock()
# ---------- campos_de_función_2.designscript (4 lines) ----------
BLD  = "BLD  — Building design";
STR  = "STR  — Structural design";
MEP  = "MEP  — Mechanical / Electrical / Plumbing";
INFR = "INFR — Infrastructure";
# ----------------------------------------

# group: CÓMO CREAR UN GRÁFICO DE DYNAMO
# Una guía visual de la estructura, la asignación de nombres y las prácticas recomendadas
# note: Use nodos Watch solo en puntos de control clave.
# Inutilice la secuencia de comandos no activa.
# note: Antes de ejecutar un gráfico:
# Compruebe que se hayan definido las entradas.
# Revise la vista previa/comprobaciones.
# Ejecútelo una vez manualmente antes de utilizar el Reproductor de Dynamo.
# Guarde el archivo después de ejecutarlo correctamente.
# note: Este documento le ayudará a familiarizarse con un flujo de trabajo estandarizado y con los siguientes pasos importantes.
# note: Fondo/panel posterior
información = CodeBlock()
# ---------- información.designscript (5 lines) ----------
"To keep Dynamo graphs neat and readable, we recommend following a clear
structure.

For more information, read the Dynamo Primer page on best-practice graph strategies:
https://primer2.dynamobim.org/9_best_practices/1-graph-strategies";
# ----------------------------------------
