# Dynamo graph Make a Custom Node.dyn "Crear un nodo personalizado" (Dynamo 3.0.3.7597)
# author: Dynamo
# Este documento le ayudará a familiarizarse con la creación de un nodo personalizado.

# group: Información del gráfico
# metadatos, leyenda de código de color, reglas de asignación de nombres
# note: PROYECTO DE DYNAMO
# Crear un nodo personalizado
# note: VERSIÓN DE DYNAMO
# 4.1.0
# note: VERSIÓN DE LA APLICACIÓN HOST
# N/D
# note: ARCHIVO(S) ASOCIADO(S)
# Curve_Validate.dyf
# note: PAQUETES DE DYNAMO NECESARIOS
# N/D
# note: AUTOR(ES)/FECHA DE CREACIÓN
# Archilizer for Dynamo Team/4 de febrero de 2026
# note: COMENTARIOS ADICIONALES
# Los nodos personalizados se encuentran normalmente en la sección de complementos de la biblioteca.
# Este nodo personalizado se encuentra en:
# Add-ons → Templates → Curve → Curve_Validate
# Si no aparece, realice lo siguiente:
# Compruebe que el archivo .dyf se encuentre en la carpeta de nodos personalizados.
# Acceda a la siguiente ubicación:
# Paquetes → Package Manager → Configuración de paquetes → Rutas de búsqueda de paquetes/bibliotecas
# Compruebe que la ruta de la carpeta aparece en la lista o añada una nueva ruta.
# Reinicie Dynamo después de añadir nuevos nodos personalizados.
# note: DESCRIPCIÓN
# Este documento le ayudará a familiarizarse con la creación de un nodo personalizado.
# Para mantener las secuencias de comandos de Dynamo ordenadas y legibles, es recomendable seguir una
# estructura clara al crear gráficos.
# Obtenga más información en la página de Dynamo Primer sobre la creación de un nodo personalizado:
# https://primer2.dynamobim.org/es/6_custom_nodes_and_packages/6-1_custom-nodes/2-creating

# group: DENTRO DEL NODO PERSONALIZADO
# note: Esta secuencia de comandos comprueba y filtra la geometría de las curvas mediante reglas sencillas. Toma curvas de entrada, como líneas, arcos, etc., y verifica que cada objeto exista, sea una curva válida, cumpla una condición opcional de apertura o cierre y tenga una longitud superior a la longitud mínima seleccionada. A continuación, el nodo genera curvas válidas, curvas no válidas y una máscara de validación booleana que muestra qué curvas han superado o no las comprobaciones, lo que facilita la limpieza de la geometría, evita errores en pasos posteriores y prepara los datos para su posterior procesamiento en Dynamo.

# group: Revisar
# DEPURA Y COMPRUEBA LAS SALIDAS, QUE SE UTILIZAN PARA VERIFICAR LOS RESULTADOS SIN QUE ELLO AFECTE A LAS SALIDAS PRINCIPALES
# note: USO: Comprobaciones legibles para que pueda verificar que el gráfico funciona según lo esperado, sin cambiar resultados como nodos Watch, List.Count, cadenas de resumen, indicadores "PASS/FAIL", listas de errores, geometría de vista previa (Watch3D) y salidas de muestra.

# group: Anotaciones
# note: USO:
# PARA COMENTARIOS E INFORMACIÓN DE LA SECUENCIA DE COMANDOS.

# group: Salidas
# RESULTADOS FINALES GENERADOS POR EL GRÁFICO, LISTOS PARA LA EXPORTACIÓN O EL USO POSTERIOR
# note: USO: Resultados finales que se utilizarán posteriormente (exportados o insertados en otro gráfico), como listas finales, cadenas con formato, valores calculados, diccionarios/tablas y datos listos para exportar.

# group: Entradas
# VALORES CONTROLADOS POR EL USUARIO QUE DEFINEN LOS DATOS Y LA CONFIGURACIÓN DE DESTINO ANTES DE QUE SE PRODUZCA NINGÚN PROCESAMIENTO
# note: USO: Todos los valores controlados por el usuario que definen lo que procesará el gráfico y cómo debe comportarse.
# Por ejemplo, controles deslizantes de número, cadenas, rutas de archivos, conmutadores booleanos, menús desplegables y listas iniciales.

# group: Acciones
# OPERACIONES PRINCIPALES QUE PROCESAN LAS ENTRADAS
# note: USO: El canal de procesamiento principal que transforma las entradas en resultados. Aquí es donde se realiza el "trabajo", como la limpieza de listas, la asignación, el filtrado, la lógica de cadenas, las operaciones geométricas, la aplicación de formato y las conversiones.

# group: DENTRO DEL NODO PERSONALIZADO > Entradas
# Utilice estos controles para definir lo que significa "válido".
# Las curvas pueden ser una lista de líneas, arcos, PolyCurves o tipos de curvas mixtas.
# Utilice flattenDepth para controlar cómo se gestionan las listas anidadas.
número = DoubleInput(5)
número_2 = DoubleInput(10)
número_3 = DoubleInput(15)
byCoordinates = Point.ByCoordinates(x=número, y=número_2, z=número_3)
byCoordinates_2 = Point.ByCoordinates(x=número_3, y=número, z=número_2)
byCoordinates_3 = Point.ByCoordinates(x=número_2, y=número_3, z=número)
list_create = List.Create(elemento0=byCoordinates, elemento1=byCoordinates_2, elemento2=byCoordinates_3)
byPoints = NurbsCurve.ByPoints(puntos=list_create)
número_4 = DoubleInput(1)

# group: DENTRO DEL NODO PERSONALIZADO > Validación de valores nulos y de tipo
# Filtra los valores nulos y los objetos que no son curvas antes de ejecutar las comprobaciones de geometría de curvas.
# De este modo, se evitan las advertencias y el nodo es más seguro para las entradas mixtas.
flatten = List.Flatten(lista=byPoints, cantidad=número_4)
type = Object.Type(objeto=flatten)
isNull = Object.IsNull(objeto=flatten)
no_es = Not(x=isNull)

# group: DENTRO DEL NODO PERSONALIZADO > Tipo de geometría que se va a tener en cuenta
# Geometría similar a una curva
cadena = StringInput("Línea")
booleano = BoolSelector(true)
contains = String.Contains(cadena=type, searchFor=cadena, ignoreCase=booleano)
cadena_2 = StringInput("Curva")
contains_2 = String.Contains(cadena=type, searchFor=cadena_2, ignoreCase=booleano)
cadena_3 = StringInput("Arco")
contains_3 = String.Contains(cadena=type, searchFor=cadena_3, ignoreCase=booleano)
cadena_4 = StringInput("PolyCurve")
contains_4 = String.Contains(cadena=type, searchFor=cadena_4, ignoreCase=booleano)
or_ = Or(bool0=contains, bool1=contains_2, bool2=contains_3, bool3=contains_4)

# group (continued): DENTRO DEL NODO PERSONALIZADO > Validación de valores nulos y de tipo
and_ = And(bool0=or_, bool1=no_es)
filterByBoolMask = List.FilterByBoolMask(lista=flatten, mask=and_)

# group: DENTRO DEL NODO PERSONALIZADO > Entradas
# Utilice estos controles para definir lo que significa "válido".
# minLength es un umbral de longitud de curva mínima.
# Establezca requireClosed en "true" (verdadero) si las curvas deben estar cerradas (bucles).
número_5 = DoubleInput(5)
booleano_2 = BoolSelector(false)

# group: DENTRO DEL NODO PERSONALIZADO > Comprobaciones de geometría (longitud y cierre)
# Aplica reglas de curva:
# la longitud debe ser ≥ minLength
# Si requireClosed es "true" (verdadero), la curva debe estar cerrada.
length = Curve.Length(curva=filterByBoolMask.entrada)
# note: Las curvas más cortas que la longitud mínima no son válidas.
ge = length >= número_5
isClosed = Curve.IsClosed(curva=filterByBoolMask.entrada)
booleano_3 = BoolSelector(true)
if_ = RefactoredIf(test=booleano_2, true=isClosed, false=booleano_3)
and_2 = And(bool0=ge, bool1=if_)

# group: DENTRO DEL NODO PERSONALIZADO > Dividir curvas válidas y no válidas
# Utiliza la máscara booleana final para separar curvas en listas de curvas válidas y no válidas.
filterByBoolMask_2 = List.FilterByBoolMask(lista=filterByBoolMask.entrada, mask=and_2)

# group: DENTRO DEL NODO PERSONALIZADO > Salidas
# validCurves: curvas que han superado la validación.
# invalidCurves: curvas que no han superado la validación.
# maskValid: máscara booleana para filtrar en otras ubicaciones.
bloque_de_código = CodeBlock(maskValid=and_2)
# ---------- bloque_de_código.designscript (4 lines) ----------
// Boolean mask of validation results
 // true  = valid curve
 // false = invalid curve
 maskValid : bool[]..[];
# ----------------------------------------
bloque_de_código_2 = CodeBlock(invalidCurves=filterByBoolMask_2.salida)
# ---------- bloque_de_código_2.designscript (3 lines) ----------
// Curves that failed validation
 // These should not be used for modelling
 invalidCurves : var[]..[];
# ----------------------------------------
bloque_de_código_3 = CodeBlock(validCurves=filterByBoolMask_2.entrada)
# ---------- bloque_de_código_3.designscript (3 lines) ----------
// Curves that passed all validation checks
 // These are safe to use for modelling and automation
 validCurves : var[]..[];
# ----------------------------------------

# group: Entradas
# Utilice estos controles para definir lo que significa "válido".
# Las curvas pueden ser una lista de líneas, arcos, PolyCurves o tipos de curvas mixtas.
# Utilice flattenDepth para controlar cómo se gestionan las listas anidadas.
número_6 = DoubleInput(5)
booleano_4 = BoolSelector(false)
número_7 = DoubleInput(5)
número_8 = DoubleInput(10)
número_9 = DoubleInput(15)
byCoordinates_4 = Point.ByCoordinates(x=número_7, y=número_8, z=número_9)
byCoordinates_5 = Point.ByCoordinates(x=número_9, y=número_7, z=número_8)
byCoordinates_6 = Point.ByCoordinates(x=número_8, y=número_9, z=número_7)
list_create_2 = List.Create(elemento0=byCoordinates_4, elemento1=byCoordinates_5, elemento2=byCoordinates_6)
byPoints_2 = NurbsCurve.ByPoints(puntos=list_create_2)
número_10 = DoubleInput(1)

# group: NODO PERSONALIZADO
# Haga doble clic en el nodo para expandirlo y abrir el archivo dyf.
# note: Esta lógica se comprime como un nodo personalizado para que la comprobación de curvas sea sencilla, reutilizable y coherente en diferentes gráficos de Dynamo. En lugar de recrear los mismos pasos de validación cada vez, las reglas se incluyen en una herramienta clara que se puede reutilizar, actualizar y compartir fácilmente. Esto reduce los errores y mantiene los gráficos limpios y legibles.
curve_Validate = Custom[Curve_Validate](minLength=número_6, requireClosed=booleano_4, curveLikeGeometry=byPoints_2, flattenDepth=número_10)  # Valida la geometría de la curva mediante la comprobación de valores nulos, tipo, tolerancia de longitud y cierre opcional. Devuelve curvas válidas/no válidas, máscara booleana y los motivos del error.

# group: Salidas
# Muestra las curvas válidas, las curvas no válidas y la máscara de validación.
watch = Watch(curve_Validate.invalidCurves)
watch_2 = Watch(curve_Validate.validCurves)
watch_3 = Watch(curve_Validate.maskValid)
