# Dynamo graph Create a Graph.dyn "Créer un graphique" (Dynamo 4.0.0.3076)
# author: Dynamo
# Ce document vous aidera à vous familiariser avec un flux de travail standardisé et les étapes importantes suivantes.

# group: COMMENT CRÉER UN GRAPHIQUE DYNAMO > Exemple
# note: Générateur de noms

# group: Normes d'attribution de noms de groupe Entrées → Action → Sorties → Révision > Entrées
# VALEURS CONTRÔLÉES PAR L'UTILISATEUR QUI DÉFINISSENT LES DONNÉES ET LES PARAMÈTRES CIBLES AVANT TOUT TRAITEMENT
# note: UTILISATION: toutes les valeurs contrôlées par l'utilisateur qui définissent ce que le graphique va traiter et comment il doit se comporter.
# Tels que les curseurs de nombres, les chaînes, les chemins d'accès aux fichiers, les bascules booléennes, les listes déroulantes, les listes initiales.

# group: Normes d'attribution de noms de groupe Entrées → Action → Sorties → Révision > Actions
# OPÉRATIONS DE BASE QUI TRAITENT LES ENTRÉES
# note: UTILISATION: le principal pipeline de traitement qui transforme les entrées en résultats. C'est là que le "travail" se produit, comme le nettoyage des listes, le mappage, le filtrage, la logique des chaînes, les opérations de géométrie, la mise en forme, les conversions.

# group: Normes d'attribution de noms de groupe Entrées → Action → Sorties → Révision > Sorties
# RÉSULTATS FINAUX PRODUITS PAR LE GRAPHIQUE, PRÊTS À ÊTRE EXPORTÉS OU UTILISÉS EN AVAL
# note: UTILISATION: résultats finaux destinés à être utilisés en aval (exportés, insérés dans un autre graphique) tels que les listes finales, les chaînes formatées, les valeurs calculées, les dictionnaires/tableaux, les données prêtes à être exportées

# group: Normes d'attribution de noms de groupe Entrées → Action → Sorties → Révision > Révision
# SORTIES DE DÉBOGAGE ET DE VÉRIFICATION, UTILISÉES POUR VÉRIFIER LES RÉSULTATS SANS AFFECTER LES SORTIES PRINCIPALES
# note: UTILISATION: vérifications lisibles par l'homme afin que vous puissiez vérifier que le graphique fait ce que vous attendez, sans modifier les résultats tels que les noeuds d'observation, List.Count, les chaînes récapitulatives, les indicateurs "PASS/FAIL", les listes d'erreurs, la géométrie d'aperçu (Watch3D), les exemples de sortie.

# group: Normes d'attribution de noms de groupe Entrées → Action → Sorties → Révision > Annotations
# note: UTILISATION:
# POUR LES COMMENTAIRES ET LES INFORMATIONS SUR LE SCRIPT

# group: Informations sur le graphique
# métadonnées, légende du code couleur, règles de nommage
# note: DYNAMO PROJECT
# Créer un graphique
# note: VERSION DE DYNAMO
# 4.2.0
# note: VERSION DE L'APPLICATION HÔTE
# N/A
# note: FICHIER(S) ASSOCIÉ(S)
# N/A
# note: MODULES DYNAMO REQUIS
# N/A
# note: AUTEUR(S)/DATE DE CRÉATION
# Archilizer pour l'équipe Dynamo / 4 févr. 2026
# note: COMMENTAIRES ADDITIONNELS
# N/A
# note: DESCRIPTION
# Ce document vous aidera à vous familiariser avec un flux de travail standardisé et les étapes importantes suivantes

# group: COMMENT CRÉER UN GRAPHIQUE DYNAMO > Informations sur le graphique
# métadonnées, légende du code couleur, règles de nommage
# note: PROJET DYNAMO
# Voir les normes d'attribution de noms de fichiers de graphiques
# note: DYNAMO VERSION
# note: VERSION DE L'APPLICATION HÔTE
# note: FICHIER(S) ASSOCIÉ(S)
# note: MODULES DYNAMO REQUIS
# note: AUTEUR(S)/DATE DE CRÉATION
# note: COMMENTAIRES ADDITIONNELS
# note: DESCRIPTION
# La description du graphique doit indiquer
# ce que fait le graphique, quelles données il utilise,
# les règles qu'il applique, ce qu'il produit,
# où et comment il s'exécute (application hôte + version) et les principales limites

# group: COMMENT CRÉER UN GRAPHIQUE DYNAMO > Dynamo Player Entrées → Actions → Sorties
# Dynamo Player permet d'exécuter des graphiques Dynamo sans ouvrir l'interface Dynamo.
# Les utilisateurs n'interagissent qu'avec des entrées prédéfinies et exécutent le script
# note: Cliquez avec le bouton droit de la souris sur votre nœud d'entrée et sélectionnez "Est une entrée"
votre_participation = StringInput("Joueur Dynamo")  # graph input
votre_action = String.ToUpper(string=votre_participation)
# note: Faites un clic droit sur votre nœud d'entrée et sélectionnez "Est une sortie"
votre_sortie = Watch(votre_action)  # graph output

# group: COMMENT CRÉER UN GRAPHIQUE DYNAMO > Normes de dénomination des noeuds
# note: Ne modifiez pas l'intégralité du nom du noeud. Utilisez plutôt des parenthèses à la fin.
string = StringInput("")
# note: FAIRE
string_entrée_1 = StringInput("")
# note: NE PAS FAIRE
# note: Mettez à jour ces règles en fonction des normes de votre bureau
entrée_1 = StringInput("")
règles_typiques_à_faire_à_ne_pas = CodeBlock()  # "Règles typiques à faire/à ne pas faire"
# ---------- règles_typiques_à_faire_à_ne_pas.designscript (12 lines) ----------
/*
Do:
Rename key nodes only (inputs, rules, outputs, decision logic)
Use notes to add context to your script
Use capitalization consistently (e.g. Title Case or camelCase, not mixed)
*/

/*Do Not:
Rename every node in the graph
Leave important nodes with default names if they affect logic
Use vague names like "Data", "Stuff", "Fix", "Test"
*/;
# ----------------------------------------

# group: COMMENT CRÉER UN GRAPHIQUE DYNAMO > Normes de dénomination des fichiers graphiques
# Afin de comprendre le but ou l'utilisation prévue d'un graphique par son nom, nous suggérons de suivre un modèle de nommage similaire à la convention du plan d'exécution BIM:
string_2 = StringInput("-")
organisation = CodeBlock { "AUT"; }
champs_de_fonction = CodeBlock { BLD  = "BLD"; STR  = "STR"; MEP  = "MEP"; INFR = "INFR"; }
description = CodeBlock { "Logical_description"; }
version_dynamo = CodeBlock { "D303"; }
script_version_uniquement_pour = CodeBlock { "V2"; }  # "Script-Version (uniquement pour les fichiers de sauvegarde)"
ordre_d_assemblage = String.Join(separator=string_2, string0=organisation, string1=champs_de_fonction.BLD, string2=description, string3=version_dynamo, string4=script_version_uniquement_pour)
exemple_de_nom = Watch(ordre_d_assemblage)
# note: Structure de dénomination recommandée
structure_de_dénomination = CodeBlock()
# ---------- structure_de_dénomination.designscript (3 lines) ----------
["Organisation  | Function fields | Description         | Dynamo-Version | Script-Version",
"AUT            |BLD              | Logical_description | D303           | V3"
];
# ----------------------------------------
# note: NE PAS MODIFIER:
# note: Les champs de fonction décrivent la zone de travail/domaine principal du script
champs_de_fonction_2 = CodeBlock()
# ---------- champs_de_fonction_2.designscript (4 lines) ----------
BLD  = "BLD  — Building design";
STR  = "STR  — Structural design";
MEP  = "MEP  — Mechanical / Electrical / Plumbing";
INFR = "INFR — Infrastructure";
# ----------------------------------------

# group: COMMENT CRÉER UN GRAPHIQUE DYNAMO
# Un guide visuel sur la structure, la dénomination et les meilleures pratiques
# note: Utiliser les noeuds de surveillance uniquement aux points de contrôle clés
# Geler le script non actif
# note: Avant d'exécuter un graphique:
# Vérifier que les entrées sont définies
# Vérifier l'aperçu/vérifications
# Exécuter une fois manuellement avant d'utiliser Dynamo Player
# Enregistrer le fichier après une exécution réussie
# note: Ce document vous aidera à vous familiariser avec un flux de travail standardisé et les étapes importantes suivantes
# note: Arrière-plan/panneau arrière
informations = CodeBlock()
# ---------- informations.designscript (5 lines) ----------
"To keep Dynamo graphs neat and readable, we recommend following a clear
structure.

For more information, read the Dynamo Primer page on best-practice graph strategies:
https://primer2.dynamobim.org/9_best_practices/1-graph-strategies";
# ----------------------------------------
