# Dynamo graph Import & Export Workflow.dyn "Flux de travail d'importation et d'exportation" (Dynamo 4.0.0.3076)
# author: Dynamo
# Ce document vous aidera à vous familiariser avec les différentes façons d'importer et d'exporter des fichiers Excel et CSV.

# group: Informations sur le graphique
# métadonnées, légende du code couleur, règles de nommage
# note: PROJET DYNAMO
# Flux de travail d'importation et d'exportation
# note: VERSION DE DYNAMO
# 4.2.0
# note: VERSION DE L'APPLICATION HÔTE
# N/A
# note: FICHIER(S) ASSOCIÉ(S)
# N/A
# note: MODULES DYNAMO REQUIS
# N/A
# note: AUTEUR(S)/DATE DE CRÉATION
# Archilizer pour l'équipe Dynamo / 4 févr. 2026
# note: COMMENTAIRES ADDITIONNELS
# N/A
# note: DESCRIPTION
# Ce document vous aidera à vous familiariser avec les différentes façons d'importer et d'exporter des fichiers Excel et CSV.
# Une seule méthode de saisie doit être utilisée à la fois. Figez les scripts non utilisés.

# group: Révision
# SORTIES DE DÉBOGAGE ET DE VÉRIFICATION, UTILISÉES POUR VÉRIFIER LES RÉSULTATS SANS AFFECTER LES SORTIES PRINCIPALES
# note: UTILISATION: vérifications lisibles par l'homme afin de vous permettre de vérifier que le graphique fait ce que vous attendez, sans modifier les résultats tels que les noeuds d'observation, List.Count, les chaînes récapitulatives, les indicateurs "PASS/FAIL", les listes d'erreurs, la géométrie d'aperçu (Watch3D) et les exemples de sortie.

# group: Annotations
# note: UTILISATION:
# POUR LES COMMENTAIRES ET LES INFORMATIONS SUR LE SCRIPT.

# group: Sorties
# RÉSULTATS FINAUX PRODUITS PAR LE GRAPHIQUE, PRÊTS À ÊTRE EXPORTÉS OU UTILISÉS EN AVAL
# note: UTILISATION: résultats finaux destinés à être utilisés en aval (exportés, insérés dans un autre graphique) tels que les listes finales, les chaînes formatées, les valeurs calculées, les dictionnaires/tableaux et les données prêtes à être exportées.

# group: Entrées
# VALEURS CONTRÔLÉES PAR L'UTILISATEUR QUI DÉFINISSENT LES DONNÉES ET LES PARAMÈTRES CIBLES AVANT TOUT TRAITEMENT
# note: UTILISATION: toutes les valeurs contrôlées par l'utilisateur qui définissent ce que le graphe va traiter et comment il doit se comporter.
# tels que: curseurs de nombres, chaînes, chemins de fichiers, valeurs booléennes, listes déroulantes et listes initiales.

# group: Actions
# OPÉRATIONS DE BASE QUI TRAITENT LES ENTRÉES
# note: UTILISATION: le principal pipeline de traitement qui transforme les entrées en résultats. C'est là que le "travail" se produit, comme le nettoyage des listes, le mappage, le filtrage, la logique des chaînes, les opérations de géométrie, la mise en forme et les conversions.

# group: Importation/exportation CSV
# Ce script importe les données CSV, les analyse et les restructure en fonction de règles de dénomination définies, et sépare les entrées valides et non valides pour révision et correction. Dans ce processus, une liste de noms est traitée à l'aide d'une logique de validation basée sur des règles, triée selon les conventions d'attribution de noms et classée en groupes valides et non valides. Les noms valides sont exportés pour une utilisation en aval, comme la coordination et la génération de rapports
# note: Conseils: ajoutez un nœud d'observation après votre saisie pour vérifier comment votre fichier est importé

# group: Importation/exportation Excel > Importation Excel
# Importez les données d'un fichier Excel (.xlsx) dans Dynamo, en convertissant les lignes et les colonnes de la feuille de calcul en listes structurées pour traitement, validation et manipulation. Les utilisations courantes incluent les planifications, les paramètres et les quantités pour les processus en aval
# note: Cliquez sur Parcourir et sélectionnez votre propre fichier Excel (.xlsx) avant d'exécuter ce graphe
file_path = Filename("Aucun fichier n'est sélectionné.")
string = StringInput("Feuille1")
# note: Définissez sur false lors de la lecture des nombres.
# Définissez la valeur true lors de la lecture du texte.
boolean = BoolSelector(false)
openXMLImportExcel = Data.OpenXMLImportExcel(filePath=file_path, sheetName=string, readAsString=boolean)
# note: Utilisez List.Transpose pour lire les colonnes de votre liste.
# Ne transposez pas pour lire les lignes de votre liste.
transpose = List.Transpose()  # unwired: lists

# group: Importation/exportation Excel > Structuration des données pour Excel
# Supprime les entrées nulles/vides et supprime les en-têtes
# note: Récupérer les en-têtes
deconstruct = List.Deconstruct(list=openXMLImportExcel)
boolean_2 = BoolSelector(false)
clean = List.Clean(list=deconstruct.rest, preserveIndices=boolean_2)

# group: Importation/exportation Excel > Grouper par similarité
# Exemple de manipulation de données pour Excel
transpose_2 = List.Transpose(lists=clean)
bloc_de_code_index_des_colonnes = CodeBlock { 1; }
# note: Utilisé uniquement pour extraire une seule colonne clé
getItemAtIndex = List.GetItemAtIndex(list=transpose_2, index=bloc_de_code_index_des_colonnes)
number = DoubleInput(0)
boolean_3 = BoolSelector(false)
groupBySimilarity = List.GroupBySimilarity(list=getItemAtIndex, tolerance=number, considerAdjacency=boolean_3)

# group: Importation/exportation Excel > Extraction de colonne de plancher
# Confirme l'index des colonnes
watch = Watch(getItemAtIndex)

# group: Importation/exportation CSV > Importation de fichiers CSV
# Importe des données CSV dans Dynamo et les structure pour des flux de travail de validation, de tri et de classification basés sur des règles
# note: Cliquez sur Parcourir et sélectionnez votre propre fichier CSV (.csv) avant d'exécuter ce graphe
file_path_2 = Filename("Aucun fichier n'est sélectionné.")
boolean_4 = BoolSelector(true)
# note: transposer la liste si vous voulez lire les colonnes.
# Ne pas transposer la liste si vous voulez lire les lignes
importCSV = Data.ImportCSV(filePath=file_path_2, transpose=boolean_4)

# group: Importation/exportation CSV > Structuration des données pour Csv
# Structuration des données: fusionne et nettoie les entrées afin que les règles en aval reçoivent toujours une liste cohérente de chaînes (pas de valeurs nulles, pas de listes imbriquées, format propre).
deconstruct_2 = List.Deconstruct(list=importCSV)
transpose_3 = List.Transpose(lists=deconstruct_2.rest)
bloc_de_code_index_de_la_colonne = CodeBlock { 0; }  # "Bloc de code (index de la colonne à lire)"
getItemAtIndex_2 = List.GetItemAtIndex(list=transpose_3, index=bloc_de_code_index_de_la_colonne)
boolean_5 = BoolSelector(false)
clean_2 = List.Clean(list=getItemAtIndex_2, preserveIndices=boolean_5)

# group: Importation/exportation CSV > Révision
# Vérifier l'extraction des en-têtes
watch_en_têtes = Watch(deconstruct_2.first)

# group: Importation/exportation CSV > Définitions des mots-clés
# Paramètres modifiables par l'utilisateur qui définissent les règles de nommage de l'entreprise utilisées par les vérifications (majuscule, mots-clés et séparateur obligatoire). Mettez-les à jour pour qu'elles correspondent aux normes de votre projet ou de votre entreprise.
# note: Modifier cette liste pour qu'elle corresponde aux conventions de dénomination des bureaux
toUpper = String.ToUpper(string=clean_2)
code_block = CodeBlock { "-"; }
code_block_2 = CodeBlock()
# ---------- code_block_2.designscript (2 lines) ----------
// une liste de sortie
["GA","DET","STRUCT"];
# ----------------------------------------
code_block_3 = CodeBlock { 0; }
code_block_4 = CodeBlock { 1; }
code_block_5 = CodeBlock { 2; }

# group: Importation/exportation CSV > Vérification des règles (majuscules + séparateur)
# Génère des sorties de règle booléenne par nom. Vérifie si chaque nom est en majuscules et s'il contient la chaîne de séparation requise
eq = clean_2 == toUpper
contains = String.Contains(string=clean_2, searchFor=code_block)

# group: Importation/exportation CSV > Vérification des mots-clés (contient n'importe quel mot-clé)
# Vérifie si chaque nom contient au moins un mot-clé approuvé. Génère une liste booléenne où chaque élément correspond au nom correspondant.
getItemAtIndex_3 = List.GetItemAtIndex(list=code_block_2, index=code_block_3)
contains_2 = String.Contains(string=clean_2, searchFor=getItemAtIndex_3)
getItemAtIndex_4 = List.GetItemAtIndex(list=code_block_2, index=code_block_4)
contains_3 = String.Contains(string=clean_2, searchFor=getItemAtIndex_4)
or_ = Or(bool0=contains_2, bool1=contains_3)
getItemAtIndex_5 = List.GetItemAtIndex(list=code_block_2, index=code_block_5)
contains_4 = String.Contains(string=clean_2, searchFor=getItemAtIndex_5)
or_2 = Or(bool0=or_, bool1=contains_4)

# group: Importation/exportation CSV > Combiner les vérifications dans le masque final
# Combine toutes les sorties de règles en un masque booléen final à l'aide de la logique. Ce masque définit si chaque nom est valide ou non valide.
and_ = And(bool0=eq, bool1=contains)
and_2 = And(bool0=and_, bool1=or_2)

# group: Importation/exportation CSV > Noms valides et noms non valides
# Sorties: divise la liste des noms d'entrée en résultats valides et non valides en fonction du masque final
filterByBoolMask = List.FilterByBoolMask(list=clean_2, mask=and_2)

# group: Importation/exportation CSV > Débogage et résumé
# Vérifications visuelles pour confirmer les entrées, les règles et les sorties
noms_valides = Watch(filterByBoolMask.in)
noms_non_valides = Watch(filterByBoolMask.out)

# group: Importation/exportation CSV > Exporter au format CSV
# Exporte les ensembles valides de nom
file_path_3 = Filename("Aucun fichier n'est sélectionné.")
exportCSV = Data.ExportCSV(filePath=file_path_3, data=filterByBoolMask.in)

# group: Importation/exportation Excel > Révision/étage groupé
# Aperçu des valeurs d'étage groupées après l'agrégation des similarités. Permet de vérifier la cohérence des regroupements et des noms
watch_2 = Watch(groupBySimilarity.groupedValues)

# group: Importation/exportation Excel > Révision/étage groupé
# Aperçu des valeurs d'étage groupées après l'agrégation des similarités. Permet de vérifier la cohérence des regroupements et des noms
watch_3 = Watch(groupBySimilarity.groupedIndices)

# group: Importation/exportation Excel
# Ce script importe des données structurées à partir d'Excel, les traite et les réorganise en fonction de règles définies, puis exporte le résultat transformé pour un usage externe. Dans ce processus, une liste de pièces est importée, analysée et réorganisée par emplacement, en regroupant les pièces dans des listes structurées en fonction de critères spatiaux. Les données traitées sont ensuite exportées pour être utilisées dans la coordination et la création de rapports.
integer_slider = IntegerSlider(1, range=0..2 step 1)

# group: Importation/exportation Excel > Insérer des en-têtes avant l'exportation (facultatif)
# Insère une ligne d'en-tête au début des données exportées.
# note: Utilise GroupedIndex pour extraire les lignes d'origine
getItemAtIndex_6 = List.GetItemAtIndex(list=clean, index=groupBySimilarity.groupedIndices)
flatten = List.Flatten(list=getItemAtIndex_6, amount=integer_slider)
integer_slider_2 = IntegerSlider(0, range=0..2 step 1)
# note: Insère les en-têtes à l'index 0 avant l'exportation
insert = List.Insert(list=flatten, element=deconstruct.first, index=integer_slider_2)

# group: Importation/exportation Excel > Révision/structure des lignes groupées
# Vérifie la structure des lignes imbriquées avant l'aplatissement et l'exportation
watch_4 = Watch(insert)

# group: Importation/exportation Excel > Exporter vers Excel
# Exporte des données Dynamo structurées vers un fichier Excel (.xlsx). Prise en charge des extrants pour révision externe et intégration avec d'autres outils
# note: Le nom du fichier d'exportation doit se terminer par .xlsx
# Si un fichier portant le même nom existe déjà et que l'option Écraser est définie sur false, l'exportation échoue et aucun nouveau fichier n'est créé.
# Pour remplacer un fichier existant, l'option Remplacer doit être activée.
chemin_de_fichier = Filename("Aucun fichier n'est sélectionné.")
string_2 = StringInput("\"Exporter la feuille\"")
integer_slider_3 = IntegerSlider(0, range=0..100 step 1)
boolean_6 = BoolSelector(true)
openXMLExportExcel = Data.OpenXMLExportExcel(filePath=chemin_de_fichier, sheetName=string_2, data=insert, startRow=integer_slider_3, startColumn=integer_slider_3, writeAsString=boolean_6)

# group: Importation/exportation de géométrie > Importation de géométrie
# Importe la géométrie d'un fichier SAT dans Dynamo et la convertit en courbes, surfaces et solides modifiables pour les flux de travail de transformation
# note: Cliquez sur Parcourir et sélectionnez votre propre fichier SAT (.sat) avant d'exécuter ce graphe
file_path_4 = Filename("Aucun fichier n'est sélectionné.")
file_from_path = FileObject(path=file_path_4)
units = Units("Meters")
# note: Importe le fichier en tant que solides/surfaces/courbes Dynamo
importFromSATWithUnits = Geometry.ImportFromSATWithUnits(file_filePath=file_from_path, dynamoUnit=units)
watch_3d_aperçu_de_la_géométrie = Watch3D(importFromSATWithUnits)  # "Watch 3D (aperçu de la géométrie importée)"

# group: Importation/exportation de géométrie > Débogage/groupe d'apprentissage
# Indique ce que Dynamo pense que chaque élément est (solide, surface, courbe, etc.).
# Utile si les importations se comportent de manière inattendue.
type = Object.Type(object=importFromSATWithUnits)
watch_5 = Watch(type)

# group: Importation/exportation de géométrie > Transformation
# Met à l'échelle la géométrie importée selon un facteur uniforme
XY = Plane.XY()
code_block_6 = CodeBlock { 5; }
scale = Geometry.Scale(geometry=importFromSATWithUnits, plane=XY, xamount=code_block_6, yamount=code_block_6, zamount=code_block_6)

# group: Importation/exportation de géométrie > Exporter au format SAT
# Exportez la géométrie mise à jour en tant que fichier SAT. Le fichier SAT peut être importé dans Autocad, Revit, etc.
file_path_5 = Filename("Aucun fichier n'est sélectionné.")
exportToSAT = Geometry.ExportToSAT(geometry=scale, filePath=file_path_5)
watch_3d_aperçu_de_la_géométrie_2 = Watch3D(scale)  # "Watch 3D (Aperçu de la géométrie à l'échelle)"
