# Dynamo graph Make a Custom Node.dyn "Créer un noeud personnalisé" (Dynamo 3.0.3.7597)
# author: Dynamo
# Ce document vous aidera à vous familiariser avec la création d'un noeud personnalisé.

# group: Informations sur le graphique
# métadonnées, légende du code couleur, règles de nommage
# note: PROJET DYNAMO
# Créer un noeud personnalisé
# note: VERSION DE DYNAMO
# 4.2.0
# note: VERSION DE L'APPLICATION HÔTE
# N/A
# note: FICHIER(S) ASSOCIÉ(S)
# Curve_Validate.dyf
# note: MODULES DYNAMO REQUIS
# N/A
# note: AUTEUR(S)/DATE DE CRÉATION
# Archilizer pour l'équipe Dynamo / 4 févr. 2026
# note: COMMENTAIRES SUPPLÉMENTAIRES
# Les noeuds personnalisés se trouvent généralement dans la section Modules complémentaires de la bibliothèque.
# Ce noeud personnalisé se trouve sous:
# Modules complémentaires → Gabarits → Curve → Curve_Validate
# S'il n'apparaît pas:
# Vérifiez que le fichier .dyf se trouve dans votre dossier de noeuds personnalisés
# Accédez à:
# Paquets → Gestionnaire de paquets → Paramètres des paquets → Chemins de recherche de paquets/bibliothèque
# Vérifiez que le chemin d'accès au dossier est répertorié ou ajoutez un nouveau chemin
# Redémarrez Dynamo après avoir ajouté de nouveaux noeuds personnalisés
# note: DESCRIPTION
# Ce document vous aidera à vous familiariser avec la création d'un noeud personnalisé.
# Pour que les scripts Dynamo restent propres et lisibles, nous vous recommandons de suivre une
# structure claire lors de la création de graphiques.
# Pour en savoir plus, consultez la page Dynamo Primer sur la création d'un noeud personnalisé :
# https://primer2.dynamobim.org/fr/6_custom_nodes_and_packages/6-1_custom-nodes/2-creating

# group: À L'INTÉRIEUR DE VOTRE NOEUD PERSONNALISÉ
# note: Ce script vérifie et filtre la géométrie de la courbe à l'aide de règles simples. Il prend les courbes d'entrée telles que les lignes, les arcs, etc., et vérifie que chaque objet existe, qu'il s'agit d'une courbe valide, qu'il répond à une condition d'ouverture ou de fermeture facultative et qu'il est plus long qu'une longueur minimale choisie. Le noeud génère ensuite les courbes valides et les courbes non valides, ainsi qu'un masque de validation booléen indiquant les courbes qui ont réussi ou échoué les vérifications, ce qui facilite le nettoyage de la géométrie, évite les erreurs dans les étapes ultérieures et prépare les données pour un traitement ultérieur dans Dynamo.

# group: Révision
# SORTIES DE DÉBOGAGE ET DE VÉRIFICATION, UTILISÉES POUR VÉRIFIER LES RÉSULTATS SANS AFFECTER LES SORTIES PRINCIPALES
# note: UTILISATION: vérifications lisibles par l'homme afin de vous permettre de vérifier que le graphique fait ce que vous attendez, sans modifier les résultats tels que les noeuds d'observation, List.Count, les chaînes récapitulatives, les indicateurs "PASS/FAIL", les listes d'erreurs, la géométrie d'aperçu (Watch3D) et les exemples de sortie.

# group: Annotations
# note: UTILISATION:
# POUR LES COMMENTAIRES ET LES INFORMATIONS SUR LE SCRIPT.

# group: Sorties
# RÉSULTATS FINAUX PRODUITS PAR LE GRAPHIQUE, PRÊTS À ÊTRE EXPORTÉS OU UTILISÉS EN AVAL
# note: UTILISATION: résultats finaux destinés à être utilisés en aval (exportés, insérés dans un autre graphique) tels que les listes finales, les chaînes formatées, les valeurs calculées, les dictionnaires/tableaux et les données prêtes à être exportées.

# group: Entrées
# VALEURS CONTRÔLÉES PAR L'UTILISATEUR QUI DÉFINISSENT LES DONNÉES ET LES PARAMÈTRES CIBLES AVANT TOUT TRAITEMENT
# note: UTILISATION: toutes les valeurs contrôlées par l'utilisateur qui définissent ce que le graphe va traiter et comment il doit se comporter.
# tels que: curseurs de nombres, chaînes, chemins de fichiers, valeurs booléennes, listes déroulantes et listes initiales.

# group: Actions
# OPÉRATIONS DE BASE QUI TRAITENT LES ENTRÉES
# note: UTILISATION: le principal pipeline de traitement qui transforme les entrées en résultats. C'est là que le "travail" se produit, comme le nettoyage des listes, le mappage, le filtrage, la logique des chaînes, les opérations de géométrie, la mise en forme et les conversions.

# group: À L'INTÉRIEUR DE VOTRE NOEUD PERSONNALISÉ > Entrées
# Utilisez ces contrôles pour définir ce que signifie "valide".
# Les courbes peuvent être une liste de lignes, d'arcs, de polycourbes ou de types de courbes mixtes.
# Utilisez flattenDepth pour contrôler la façon dont les listes imbriquées sont gérées.
number = DoubleInput(5)
number_2 = DoubleInput(10)
number_3 = DoubleInput(15)
byCoordinates = Point.ByCoordinates(x=number, y=number_2, z=number_3)
byCoordinates_2 = Point.ByCoordinates(x=number_3, y=number, z=number_2)
byCoordinates_3 = Point.ByCoordinates(x=number_2, y=number_3, z=number)
list_create = List.Create(item0=byCoordinates, item1=byCoordinates_2, item2=byCoordinates_3)
byPoints = NurbsCurve.ByPoints(points=list_create)
number_4 = DoubleInput(1)

# group: À L'INTÉRIEUR DE VOTRE NOEUD PERSONNALISÉ > Vide et validation de type
# Filtre les valeurs nulles et les objets non courbes avant d'exécuter les vérifications de la géométrie des courbes.
# Cela permet d'éviter les avertissements et de rendre le noeud plus sûr pour les entrées mixtes.
flatten = List.Flatten(list=byPoints, amount=number_4)
type = Object.Type(objet=flatten)
isNull = Object.IsNull(objet=flatten)
not_ = Not(x=isNull)

# group: À L'INTÉRIEUR DE VOTRE NOEUD PERSONNALISÉ > Type de géométrie à prendre en compte
# Géométrie incurvée
string = StringInput("Ligne")
boolean = BoolSelector(true)
contains = String.Contains(string=type, searchFor=string, ignoreCase=boolean)
string_2 = StringInput("Courbe")
contains_2 = String.Contains(string=type, searchFor=string_2, ignoreCase=boolean)
string_3 = StringInput("Arc")
contains_3 = String.Contains(string=type, searchFor=string_3, ignoreCase=boolean)
string_4 = StringInput("PolyCurve")
contains_4 = String.Contains(string=type, searchFor=string_4, ignoreCase=boolean)
or_ = Or(bool0=contains, bool1=contains_2, bool2=contains_3, bool3=contains_4)

# group (continued): À L'INTÉRIEUR DE VOTRE NOEUD PERSONNALISÉ > Vide et validation de type
and_ = And(bool0=or_, bool1=not_)
filterByBoolMask = List.FilterByBoolMask(list=flatten, mask=and_)

# group: À L'INTÉRIEUR DE VOTRE NOEUD PERSONNALISÉ > Entrées
# Utilisez ces contrôles pour définir ce que signifie "valide".
# minLength est un seuil minimal de longueur de courbe.
# Définissez requireClosed sur true si les courbes doivent être fermées (boucles)
number_5 = DoubleInput(5)
boolean_2 = BoolSelector(false)

# group: À L'INTÉRIEUR DE VOTRE NOEUD PERSONNALISÉ > Contrôles de géométrie (longueur et fermeture)
# Applique les règles de courbe:
# length doit être ≥ minLength
# si requireClosed a la valeur vraie, la courbe doit être fermée
length = Curve.Length(curve=filterByBoolMask.in)
# note: Les courbes plus courtes que minLength ne sont pas valides.
ge = length >= number_5
isClosed = Curve.IsClosed(curve=filterByBoolMask.in)
boolean_3 = BoolSelector(true)
if_ = RefactoredIf(test=boolean_2, true=isClosed, false=boolean_3)
and_2 = And(bool0=ge, bool1=if_)

# group: À L'INTÉRIEUR DE VOTRE NOEUD PERSONNALISÉ > Diviser les courbes valides et invalides
# Utilise le masque booléen final pour séparer les courbes en listes valides et non valides.
filterByBoolMask_2 = List.FilterByBoolMask(list=filterByBoolMask.in, mask=and_2)

# group: À L'INTÉRIEUR DE VOTRE NOEUD PERSONNALISÉ > Sorties
# validCurves: courbes qui ont passé la validation
# invalidCurves: courbes dont la validation a échoué
# maskValid: masque booléen pour filtrer ailleurs
bloc_de_code = CodeBlock(maskValid=and_2)
# ---------- bloc_de_code.designscript (4 lines) ----------
// Boolean mask of validation results
 // true  = valid curve
 // false = invalid curve
 maskValid : bool[]..[];
# ----------------------------------------
bloc_de_code_2 = CodeBlock(invalidCurves=filterByBoolMask_2.out)
# ---------- bloc_de_code_2.designscript (3 lines) ----------
// Curves that failed validation
 // These should not be used for modelling
 invalidCurves : var[]..[];
# ----------------------------------------
bloc_de_code_3 = CodeBlock(validCurves=filterByBoolMask_2.in)
# ---------- bloc_de_code_3.designscript (3 lines) ----------
// Curves that passed all validation checks
 // These are safe to use for modelling and automation
 validCurves : var[]..[];
# ----------------------------------------

# group: Entrées
# Utilisez ces contrôles pour définir ce que signifie "valide".
# Les courbes peuvent être une liste de lignes, d'arcs, de polycourbes ou de types de courbes mixtes.
# Utilisez flattenDepth pour contrôler la façon dont les listes imbriquées sont gérées
number_6 = DoubleInput(5)
boolean_4 = BoolSelector(false)
number_7 = DoubleInput(5)
number_8 = DoubleInput(10)
number_9 = DoubleInput(15)
byCoordinates_4 = Point.ByCoordinates(x=number_7, y=number_8, z=number_9)
byCoordinates_5 = Point.ByCoordinates(x=number_9, y=number_7, z=number_8)
byCoordinates_6 = Point.ByCoordinates(x=number_8, y=number_9, z=number_7)
list_create_2 = List.Create(item0=byCoordinates_4, item1=byCoordinates_5, item2=byCoordinates_6)
byPoints_2 = NurbsCurve.ByPoints(points=list_create_2)
number_10 = DoubleInput(1)

# group: NOEUD PERSONNALISÉ
# Double-cliquez sur le nœud pour le développer et ouvrir le fichier dyf.
# note: Cette logique est compressée en tant que noeud personnalisé pour rendre la vérification des courbes simple, réutilisable et cohérente sur les différents graphiques Dynamo. Au lieu de reconstruire les mêmes étapes de validation à chaque fois, les règles sont contenues dans un outil clair qui peut être réutilisé, mis à jour et partagé facilement. Cela permet de réduire les erreurs, de garder les graphiques propres et lisibles
curve_Validate = Custom[Curve_Validate](minLength=number_6, requireClosed=boolean_4, curveLikeGeometry=byPoints_2, flattenDepth=number_10)  # Valide la géométrie de la courbe en vérifiant les valeurs nulles, le type, la tolérance de longueur et la fermeture facultative. Renvoie les courbes valides/non valides, le masque booléen et les raisons de l'échec.

# group: Sorties
# Affiche les courbes valides, les courbes non valides et le masque de validation.
watch = Watch(curve_Validate.invalidCurves)
watch_2 = Watch(curve_Validate.validCurves)
watch_3 = Watch(curve_Validate.maskValid)
