# Dynamo graph Template_01_DynamoWorkflowImportExport.dyn (Dynamo 4.0.0.3076)
# author: Dynamo
# This document will help you get familiarised with different way of importing and exporting excel and csv files.

# group: Keyword Definitions > Annotations
# note: Edit This List To Match Office Naming Conventions

# group: Graph Information
# metadata, colour code legend, naming rules
# note: DYNAMO PROJECT
# Template_01_DynamoWorkflowImportExport
# note: DYNAMO VERSION
# 4.1.0
# note: HOST APPLICATION VERSION
# N/A
# note: ASSOCIATED FILE(S)
# Excel_Import_Example.xlsx
# CSV_Import_Example.csv
# Geometry_Import_Example.sat
# note: REQUIRED DYNAMO PACKAGES
# N/A
# note: AUTHOR(S) / CREATION DATE
# Archilizer for Dynamo Team / Feb. 4 2026
# note: ADDITIONAL COMMENTS
# N/A
# note: DESCRIPTION
# This document will help you get familiarised with different way of importing and exporting excel and csv files.
# only one input method should be used at a time. Freeze the scripts not in use.

# group: Réviser
# DEBUG AND CHECK OUTPUTS, USED TO VERIFY RESULTS WITHOUT AFFECTING THE MAIN OUTPUTS
# note: USE : Human-readable checks so you can verify the graph is doing what you expect, without changing results such as watch nodes, List.Count, summary strings, “PASS/FAIL” flags, error lists, preview geometry (Watch3D) and sample outputs.

# group: Annotations
# note: USE:
# FOR COMMENTS AND SCRIPT INFO.

# group: Sorties
# FINAL RESULTS PRODUCED BY THE GRAPH, READY FOR EXPORT OR DOWNSTREAM USE
# note: USE: Final results intended to be used downstream (exported, plugged into another graph) such as final lists, formatted strings, calculated values, dictionaries/tables and  export-ready data.

# group: Entrées
# USER-CONTROLLED VALUES THAT DEFINE THE TARGET DATA AND SETTINGS BEFORE ANY PROCESSING OCCURS
# note: USE: All user-controlled values that define what the graph will process and how it should behave.
# such as : number sliders, strings, file paths, boolean toggles, dropdowns and initial lists.

# group: Actions
# CORE OPERATIONS THAT PROCESS THE INPUTS
# note: USE: The main processing pipeline that transforms inputs into results. This is where the “work” happens such as list cleaning, mapping, filtering, string logic, geometry operations, formatting and conversions.

# group: Csv Import/ Export
# This script imports CSV data, analyses and restructures it based on defined naming rules, and separates valid and invalid entries for review and correction. In this workflow, a list of names is processed using rule-based validation logic, sorted according to naming conventions, and classified into valid and invalid groups. The valid names are exported for downstream use such as coordination and reporting
# note: transpose list if you want to read the columns.
# don't transpose list if you wanna read the rows
# note: Tips : Add a watch node after your input to verify how your file is imported

# group: Importation Excel
# Set to false when reading numbers.
# Set to true when reading text.
boolean = BoolSelector(false)

# group: Importation Excel
# Import data from an Excel (.xlsx) file into Dynamo, converting spreadsheet rows and columns into structured lists for processing, validation and manipulation. Common uses include schedules, parameters, and quantities for downstream workflows
file_path = Filename("..\..\..\..\..\..\Desktop\Excel_Import_Example.xlsx")
string = StringInput("sheet1")
openXMLImportExcel = Data.OpenXMLImportExcel(filePath=file_path, sheetName=string, readAsString=boolean)
# note: Use List.Transpose To Read The Columns Of Your List.
# Don't Transpose To Read The Rows Of Your List.
transpose = List.Transpose()  # unwired: lists

# group: Excel Import/ Export > Data Structuring For Excel
# removes null/empty entries and remove headers
# note: Retrieve Headers
deconstruct = List.Deconstruct(list=openXMLImportExcel)
boolean_2 = BoolSelector(false)
clean = List.Clean(list=deconstruct.rest, preserveIndices=boolean_2)

# group: Excel Import/ Export > Group By Similarity
# Example of data manipulation for Excel
transpose_2 = List.Transpose(lists=clean)
code_block_column_index = CodeBlock { 1; }
# note: Used Only To Extract A Single Key Column
getItemAtIndex = List.GetItemAtIndex(list=transpose_2, index=code_block_column_index)
number = DoubleInput(0)
boolean_3 = BoolSelector(false)
groupBySimilarity = List.GroupBySimilarity(list=getItemAtIndex, tolerance=number, considerAdjacency=boolean_3)

# group: Excel Import/ Export > Floor Column Extraction
# Confirms column index
watch = Watch(getItemAtIndex)

# group: Csv Import/ Export > Csv Import
# Imports CSV data into Dynamo and structures it for rule-based validation, sorting and classification workflows
file_path_2 = Filename("..\Data\CSV_Import_Example.csv")
boolean_4 = BoolSelector(true)
importCSV = Data.ImportCSV(filePath=file_path_2, transpose=boolean_4)

# group: Csv Import/ Export > Data Structuring For Csv
# data structuring: merges and cleans input so downstream rules always receive a consistent list of strings (no nulls, no nested lists, clean format).
deconstruct_2 = List.Deconstruct(list=importCSV)
transpose_3 = List.Transpose(lists=deconstruct_2.rest)
code_block_index_of_column_to = CodeBlock { 0; }  # "Code Block (Index of column to read)"
getItemAtIndex_2 = List.GetItemAtIndex(list=transpose_3, index=code_block_index_of_column_to)
boolean_5 = BoolSelector(false)
clean_2 = List.Clean(list=getItemAtIndex_2, preserveIndices=boolean_5)

# group: Csv Import/ Export > Review
# Check extraction of headers
watch_headers = Watch(deconstruct_2.first)

# group: Keyword Definitions
# User-editable settings that define the office naming rules used by the checks (Uppercase, keywords and required separator). update these to match your project or office standard
toUpper = String.ToUpper(string=clean_2)
code_block = CodeBlock { "-"; }
code_block_2 = CodeBlock()
# ---------- code_block_2.designscript (2 lines) ----------
// one output list
["GA","DET","STRUCT"];
# ----------------------------------------
code_block_3 = CodeBlock { 0; }
code_block_4 = CodeBlock { 1; }
code_block_5 = CodeBlock { 2; }

# group: Csv Import/ Export > Rule Checks (Uppercase + Separator)
# generates boolean rule outputs per name. checks whether each name is uppercase and whether it contains the required separator string
eq = clean_2 == toUpper
contains = String.Contains(string=clean_2, searchFor=code_block)

# group: Csv Import/ Export > Keyword Check (Contains Any Keyword)
# checks whether each name contains at least one approved keyword. outputs a boolean list where each item corresponds to the matching name.
getItemAtIndex_3 = List.GetItemAtIndex(list=code_block_2, index=code_block_3)
contains_2 = String.Contains(string=clean_2, searchFor=getItemAtIndex_3)
getItemAtIndex_4 = List.GetItemAtIndex(list=code_block_2, index=code_block_4)
contains_3 = String.Contains(string=clean_2, searchFor=getItemAtIndex_4)
ou = Or(bool0=contains_2, bool1=contains_3)
getItemAtIndex_5 = List.GetItemAtIndex(list=code_block_2, index=code_block_5)
contains_4 = String.Contains(string=clean_2, searchFor=getItemAtIndex_5)
ou_2 = Or(bool0=ou, bool1=contains_4)

# group: Csv Import/ Export > Combine Checks Into Final Mask
# combines all rule outputs into one final boolean mask using and logic. this mask defines whether each name is valid or invalid.
et = And(bool0=eq, bool1=contains)
et_2 = And(bool0=et, bool1=ou_2)

# group: Csv Import/ Export > Valid Vs Invalid Names
# outputs: splits the input name list into valid and invalid results based on the final mask
filterByBoolMask = List.FilterByBoolMask(list=clean_2, mask=et_2)

# group: Csv Import/ Export > Debug And Summary
# Visual checks to confirm input, rules, and outputs
valid_names = Watch(filterByBoolMask.in)
invalid_names = Watch(filterByBoolMask.out)

# group: Csv Import/ Export > Exporter au format CSV
# exports the valida sets of name
file_path_3 = Filename("..\..\..\..\..\..\Desktop\CSV_Export_Example")
exportCSV = Data.ExportCSV(filePath=file_path_3, data=filterByBoolMask.in)

# group: Excel Import/ Export > Review/ Grouped Floor
# Preview of grouped Floor values after similarity clustering. Used to verify correct grouping and naming consistency
watch_2 = Watch(groupBySimilarity.groupedValues)

# group: Excel Import/ Export > Review/ Grouped Floor
# Preview of grouped Floor values after similarity clustering. Used to verify correct grouping and naming consistency
watch_3 = Watch(groupBySimilarity.groupedIndices)

# group: Excel Import/ Export
# This script imports structured data from Excel, processes and reorganises it based on defined rules, and exports the transformed result for external use. In this workflow, a list of rooms is imported, analysed and rearranged by location, grouping rooms into structured lists based on spatial criteria. The processed data is then exported for use in coordination and reporting.
integer_slider = IntegerSlider(1, range=0..2 step 1)

# group: Excel Import/ Export > Insert Headers Before Export (Optional)
# Inserts a header row at the beginning of the exported data.
# note: Uses GroupedIndices To Pull The Original Rows
getItemAtIndex_6 = List.GetItemAtIndex(list=clean, index=groupBySimilarity.groupedIndices)
flatten = List.Flatten(list=getItemAtIndex_6, amount=integer_slider)
integer_slider_2 = IntegerSlider(0, range=0..2 step 1)
# note: Inserts Headers At Index 0 Before Export
insert = List.Insert(list=flatten, element=deconstruct.first, index=integer_slider_2)

# group: Excel Import/ Export > Review/ Grouped Rows Structure
# Checks nested row structure before flattening and export
watch_4 = Watch(insert)

# group: Excel Import/ Export > Exporter vers Excel
# Exports structured Dynamo data to an Excel (.xlsx) . Supports outputs for external review and integration with other tools
# note: Your export file name must end with .xlsx
# If a file with the same name already exists and Overwrite is set to false, the export will fail and no new file will be created.
# To replace an existing file, Overwrite must be enabled.
file_path_4 = Filename("..\..\..\..\..\..\Desktop\Excel_Export_Example.xlsx")
string_2 = StringInput("\"Export sheet\"")
integer_slider_3 = IntegerSlider(0, range=0..100 step 1)
boolean_6 = BoolSelector(true)
openXMLExportExcel = Data.OpenXMLExportExcel(filePath=file_path_4, sheetName=string_2, data=insert, startRow=integer_slider_3, startColumn=integer_slider_3, writeAsString=boolean_6)

# group: Geometry Import / Export > Importation de géométrie
# Imports geometry from a SAT file into Dynamo and converts it into editable curves, surfaces and solids for transformation workflows
file_path_5 = Filename("..\..\..\..\..\..\Desktop\Geometry_Import_Example.sat")
fichier_à_partir_du_chemin = FileObject(path=file_path_5)
unités = Units("Meters")
# note: Imports the file as Dynamo Solids/Surfaces/Curves
importFromSATWithUnits = Geometry.ImportFromSATWithUnits(file_filePath=fichier_à_partir_du_chemin, dynamoUnit=unités)
watch_3d_preview_of_imported = Watch3D(importFromSATWithUnits)  # "Watch 3D ( Preview of imported geometry)"

# group: Geometry Import / Export > Debug/Learning Group
# Shows what Dynamo thinks each item is (Solid, Surface, Curve, etc.).
# Useful if imports behave unexpectedly.
type = Object.Type(object=importFromSATWithUnits)
watch_5 = Watch(type)

# group: Geometry Import / Export > Transformation
# Scales imported geometry by a uniform factor
XY = Plane.XY()
code_block_6 = CodeBlock { 5; }
scale = Geometry.Scale(geometry=importFromSATWithUnits, plane=XY, xamount=code_block_6, yamount=code_block_6, zamount=code_block_6)

# group: Geometry Import / Export > Export To SAT
# Export the updated geometry as a SAT file. The SAT file can be imported to Autocad, Revit etc..
file_path_6 = Filename("..\..\..\..\..\..\Desktop\Geometry_Export_Example.sat")
exportToSAT = Geometry.ExportToSAT(geometry=scale, filePath=file_path_6)
watch_3d_preview_scaled_geometry = Watch3D(scale)
