# Dynamo graph Create a Graph.dyn "Crea un grafico" (Dynamo 4.0.0.3076)
# author: Dynamo
# Questo documento consentirà di acquisire familiarità con un workflow standardizzato e con i seguenti passaggi importanti.

# group: COME CREARE UN GRAFICO DI DYNAMO > Esempio
# note: Generatore di nomi

# group: Standard di denominazione dei gruppi Input → Azione → Output → Revisione > Input
# VALORI CONTROLLATI DALL'UTENTE CHE DEFINISCONO I DATI E LE IMPOSTAZIONI DI DESTINAZIONE PRIMA DELL'ELABORAZIONE.
# note: USO: tutti i valori controllati dall'utente che definiscono cosa verrà elaborato dal grafico e come dovrebbe comportarsi,
# come dispositivi di scorrimento numerici, stringhe, percorsi di file, pulsanti di commutazione booleani, menu a discesa, elenchi iniziali.

# group: Standard di denominazione dei gruppi Input → Azione → Output → Revisione > Azioni
# OPERAZIONI PRINCIPALI CHE ELABORANO GLI INPUT
# note: USO: la pipeline di elaborazione principale che trasforma gli input in risultati. È qui che avviene il "lavoro" come la pulizia degli elenchi, la mappatura, il filtraggio, la logica delle stringhe, le operazioni geometriche, la formattazione, le conversioni.

# group: Standard di denominazione dei gruppi Input → Azione → Output → Revisione > Output
# RISULTATI FINALI PRODOTTI DAL GRAFICO, PRONTI PER L'ESPORTAZIONE O L'UTILIZZO A VALLE
# note: USO: risultati finali da utilizzare a valle (esportati, inseriti in un altro grafico), ad esempio elenchi finali, stringhe formattate, valori calcolati, dizionari/tabelle, dati pronti per l'esportazione

# group: Standard di denominazione dei gruppi Input → Azione → Output → Revisione > Rivedi
# OUTPUT DI DEBUG E CONTROLLO, UTILIZZATI PER VERIFICARE I RISULTATI SENZA INFLUIRE SUGLI OUTPUT PRINCIPALI
# note: USO: controlli leggibili dall'utente in modo da poter verificare che il grafico funzioni come previsto, senza modificare i risultati come nodi Watch, List.Count, stringhe di riepilogo, flag "PASS/FAIL", elenchi di errori, geometria di anteprima (Watch 3D), output di esempio.

# group: Standard di denominazione dei gruppi Input → Azione → Output → Revisione > Annotazioni
# note: USO:
# PER COMMENTI E INFORMAZIONI SULLO SCRIPT

# group: Informazioni sul grafico
# Metadati, legenda dei codici colore, regole di denominazione
# note: PROGETTO DI DYNAMO
# Crea un grafico
# note: VERSIONE DI DYNAMO
# 4.1.0
# note: VERSIONE DELL'APPLICAZIONE HOST
# N/A
# note: FILE ASSOCIATI
# N/A
# note: PACCHETTI DI DYNAMO RICHIESTI
# N/A
# note: AUTORI/DATA DI CREAZIONE
# Archilizer per il team di Dynamo/4 febbraio 2026
# note: COMMENTI AGGIUNTIVI
# N/A
# note: DESCRIZIONE
# Questo documento consentirà di acquisire familiarità con un workflow standardizzato e con i seguenti importanti passaggi

# group: COME CREARE UN GRAFICO DI DYNAMO > Informazioni sul grafico
# Metadati, legenda dei codici colore, regole di denominazione
# note: PROGETTO DI DYNAMO
# Vedere Standard di denominazione dei file grafici
# note: VERSIONE DI DYNAMO
# note: VERSIONE DELL'APPLICAZIONE HOST
# note: FILE ASSOCIATI
# note: PACCHETTI DI DYNAMO RICHIESTI
# note: AUTORI/DATA DI CREAZIONE
# note: COMMENTI AGGIUNTIVI
# note: DESCRIZIONE
# La descrizione del grafico deve indicare
# a cosa serve il grafico, quali dati utilizza,
# quali regole applica, cosa produce,
# dove e come viene eseguito (app host + versione) e qualsiasi limite chiave

# group: COME CREARE UN GRAFICO DI DYNAMO > Lettore Dynamo Input → Azioni → Output
# Il Lettore Dynamo consente di eseguire i grafici di Dynamo senza aprire l'interfaccia di Dynamo.
# Gli utenti interagiscono solo con input predefiniti ed eseguono lo script
# note: Fare clic con il pulsante destro del mouse sul nodo di input e selezionare È input
l_input_dell_utente = StringInput("Lettore Dynamo")  # graph input
l_azione_dell_utente = String.ToUpper(string=l_input_dell_utente)
# note: Fare clic con il pulsante destro del mouse sul nodo di input e selezionare È output
l_output_dell_utente = Watch(l_azione_dell_utente)  # graph output

# group: COME CREARE UN GRAFICO DI DYNAMO > Standard di denominazione dei nodi
# note: Non modificare l'intero nome del nodo. Utilizzare invece le parentesi alla fine.
string = StringInput("")
# note: FARE
string_input_1 = StringInput("")
# note: NON FARE
# note: Aggiornare queste regole in base agli standard aziendali
input_1 = StringInput("")
regole_tipiche_da_seguire_non = CodeBlock()  # "Regole tipiche da seguire/non seguire"
# ---------- regole_tipiche_da_seguire_non.designscript (12 lines) ----------
/*
Do:
Rename key nodes only (inputs, rules, outputs, decision logic)
Use notes to add context to your script
Use capitalization consistently (e.g. Title Case or camelCase, not mixed)
*/

/*Do Not:
Rename every node in the graph
Leave important nodes with default names if they affect logic
Use vague names like "Data", "Stuff", "Fix", "Test"
*/;
# ----------------------------------------

# group: COME CREARE UN GRAFICO DI DYNAMO > Standard di denominazione dei fili grafici
# Per comprendere lo scopo o l'uso previsto di un grafico in base al nome, è consigliabile seguire un modello di denominazione simile alla convenzione del piano di esecuzione BIM:
string_2 = StringInput("-")
organizzazione = CodeBlock { "AUT"; }
campi_funzione = CodeBlock { BLD  = "BLD"; STR  = "STR"; MEP  = "MEP"; INFR = "INFR"; }
descrizione = CodeBlock { "Logical_description"; }
versione_di_dynamo = CodeBlock { "D303"; }
versione_di_script_solo_per_i = CodeBlock { "V2"; }  # "Versione di script (solo per i file di backup)"
ordine_di_assieme = String.Join(separator=string_2, string0=organizzazione, string1=campi_funzione.BLD, string2=descrizione, string3=versione_di_dynamo, string4=versione_di_script_solo_per_i)
esempio_di_nome = Watch(ordine_di_assieme)
# note: Struttura di denominazione consigliata
struttura_di_denominazione = CodeBlock()
# ---------- struttura_di_denominazione.designscript (3 lines) ----------
["Organisation  | Function fields | Description         | Dynamo-Version | Script-Version",
"AUT            |BLD              | Logical_description | D303           | V3"
];
# ----------------------------------------
# note: NON MODIFICARE:
# note: I campi funzione descrivono l'area/dominio di lavoro principale dello script
campi_funzione_2 = CodeBlock()
# ---------- campi_funzione_2.designscript (4 lines) ----------
BLD  = "BLD  — Building design";
STR  = "STR  — Structural design";
MEP  = "MEP  — Mechanical / Electrical / Plumbing";
INFR = "INFR — Infrastructure";
# ----------------------------------------

# group: COME CREARE UN GRAFICO DI DYNAMO
# Una guida visiva alla struttura, alla denominazione e alle procedure ottimali
# note: Utilizzare i nodi Watch solo nei punti di controllo chiave
# Congelare lo script non attivo
# note: Prima di eseguire un grafico:
# Verificare che gli input siano impostati
# Rivedere l'anteprima/i controlli
# Eseguire una volta manualmente prima di utilizzare il Lettore Dynamo
# Salvare il file dopo l'esecuzione
# note: Questo documento consentirà di acquisire familiarità con un workflow standardizzato e con i seguenti passaggi importanti
# note: Sfondo/Pannello posteriore
informazioni = CodeBlock()
# ---------- informazioni.designscript (5 lines) ----------
"To keep Dynamo graphs neat and readable, we recommend following a clear
structure.

For more information, read the Dynamo Primer page on best-practice graph strategies:
https://primer2.dynamobim.org/9_best_practices/1-graph-strategies";
# ----------------------------------------
