# Dynamo graph Import & Export Workflow.dyn "Workflow di importazione ed esportazione" (Dynamo 4.0.0.3076)
# author: Dynamo
# Questo documento consentirà di acquisire familiarità con diversi modi per importare ed esportare file Excel e CSV.

# group: Definizioni parole chiave > Annotazioni
# note: Modificare l'elenco in modo che corrisponda alle convenzioni di denominazione aziendali

# group: Informazioni sul grafico
# Metadati, legenda dei codici colore, regole di denominazione
# note: PROGETTO DI DYNAMO
# Workflow di importazione ed esportazione
# note: VERSIONE DI DYNAMO
# 4.1.0
# note: VERSIONE DELL'APPLICAZIONE HOST
# N/A
# note: FILE ASSOCIATI
# Esempio_Importazione_Excel.xlsx
# Esempio_Importazione_CSV.csv
# Esempio_Importazione_Geometria.sat
# note: PACCHETTI DI DYNAMO RICHIESTI
# N/A
# note: AUTORI/DATA DI CREAZIONE
# Archilizer per il team di Dynamo/4 febbraio 2026
# note: COMMENTI AGGIUNTIVI
# N/A
# note: DESCRIZIONE
# Questo documento consentirà di acquisire familiarità con diversi modi per importare ed esportare file Excel e CSV.
# Si deve utilizzare un solo metodo di input alla volta. Congelare gli script non in uso.

# group: Rivedi
# OUTPUT DI DEBUG E CONTROLLO, UTILIZZATI PER VERIFICARE I RISULTATI SENZA INFLUIRE SUGLI OUTPUT PRINCIPALI
# note: USO: controlli leggibili dall'utente in modo da poter verificare che il grafico funzioni come previsto, senza modificare i risultati come nodi Watch, List.Count, stringhe di riepilogo, flag "PASS/FAIL", elenchi di errori, geometria di anteprima (Watch 3D), output di esempio.

# group: Annotazioni
# note: USO:
# PER COMMENTI E INFORMAZIONI SULLO SCRIPT.

# group: Output
# RISULTATI FINALI PRODOTTI DAL GRAFICO, PRONTI PER L'ESPORTAZIONE O L'UTILIZZO A VALLE
# note: USO: risultati finali da utilizzare a valle (esportati, inseriti in un altro grafico), ad esempio elenchi finali, stringhe formattate, valori calcolati, dizionari/tabelle e dati pronti per l'esportazione.

# group: Input
# VALORI CONTROLLATI DALL'UTENTE CHE DEFINISCONO I DATI E LE IMPOSTAZIONI DI DESTINAZIONE PRIMA DELL'ELABORAZIONE.
# note: USO: tutti i valori controllati dall'utente che definiscono cosa verrà elaborato dal grafico e come dovrebbe comportarsi,
# come dispositivi di scorrimento numerici, stringhe, percorsi di file, pulsanti di commutazione booleani, menu a discesa, elenchi iniziali.

# group: Azioni
# OPERAZIONI PRINCIPALI CHE ELABORANO GLI INPUT
# note: USO: la pipeline di elaborazione principale che trasforma gli input in risultati. È qui che avviene il "lavoro" come la pulizia degli elenchi, la mappatura, il filtraggio, la logica delle stringhe, le operazioni geometriche, la formattazione e le conversioni.

# group: Importazione/Esportazione CSV
# Questo script importa i dati CSV, li analizza e li ristruttura in base a regole di denominazione definite e separa le voci valide da quelle non valide per la revisione e la correzione. In questo workflow, un elenco di nomi viene elaborato utilizzando una logica di convalida basata su regole, ordinato in base alle convenzioni di denominazione e classificato in gruppi validi e non validi. I nomi validi vengono esportati per l'utilizzo a valle, ad esempio per il coordinamento e la generazione di rapporti.
# note: Trasporre l'elenco se si desidera leggere le colonne.
# Non trasporre l'elenco se si desidera leggere le righe
# note: Suggerimenti: aggiungere un nodo Watch dopo l'input per verificare la modalità di importazione del file.

# group: Importazione in Excel
# Impostare su False durante la lettura dei numeri.
# Impostare su true durante la lettura del testo.
booleano = BoolSelector(false)

# group: Importazione in Excel
# Importa i dati da un file Excel (.xlsx) in Dynamo, convertendo righe e colonne di fogli di calcolo in elenchi strutturati per l'elaborazione, la convalida e la manipolazione. Gli utilizzi più comuni includono abachi, parametri e quantità per i workflow a valle
percorso_file = Filename("..\..\..\..\..\..\Desktop\Excel_Import_Example.xlsx")
string = StringInput("sheet1")
openXMLImportExcel = Data.OpenXMLImportExcel(filePath=percorso_file, sheetName=string, readAsString=booleano)
# note: Utilizzare List.Transpose per leggere le colonne dell'elenco.
# Non trasporre per leggere le righe dell'elenco.
transpose = List.Transpose()  # unwired: lists

# group: Importazione/Esportazione da/in Excel > Strutturazione dati per Excel
# Rimuove le voci nulle/vuote e rimuove le intestazioni.
# note: Recupera intestazioni
deconstruct = List.Deconstruct(list=openXMLImportExcel)
booleano_2 = BoolSelector(false)
clean = List.Clean(list=deconstruct.rest, preserveIndices=booleano_2)

# group: Importazione/Esportazione da/in Excel > Raggruppa per similitudine
# Esempio di manipolazione dei dati per Excel
transpose_2 = List.Transpose(lists=clean)
code_block_indice_colonna = CodeBlock { 1; }
# note: Utilizzato solo per estrarre una singola colonna chiave
getItemAtIndex = List.GetItemAtIndex(list=transpose_2, index=code_block_indice_colonna)
number = DoubleInput(0)
booleano_3 = BoolSelector(false)
groupBySimilarity = List.GroupBySimilarity(list=getItemAtIndex, tolerance=number, considerAdjacency=booleano_3)

# group: Importazione/Esportazione da/in Excel > Estrazione colonna pavimento
# Conferma indice colonna
watch = Watch(getItemAtIndex)

# group: Importazione/Esportazione CSV > Importazione CSV
# Importa dati CSV in Dynamo e li struttura per workflow di convalida, ordinamento e classificazione basati su regole
percorso_file_2 = Filename("..\Data\CSV_Import_Example.csv")
booleano_4 = BoolSelector(true)
importCSV = Data.ImportCSV(filePath=percorso_file_2, transpose=booleano_4)

# group: Importazione/Esportazione CSV > Strutturazione dati per CSV
# Strutturazione dati: unisce e pulisce l'input in modo che le regole a valle ricevano sempre un elenco coerente di stringhe (nessun valore null, nessun elenco nidificato, formato pulito).
deconstruct_2 = List.Deconstruct(list=importCSV)
transpose_3 = List.Transpose(lists=deconstruct_2.rest)
code_block_indice_della_colonna = CodeBlock { 0; }  # "Code Block (indice della colonna da leggere)"
getItemAtIndex_2 = List.GetItemAtIndex(list=transpose_3, index=code_block_indice_della_colonna)
booleano_5 = BoolSelector(false)
clean_2 = List.Clean(list=getItemAtIndex_2, preserveIndices=booleano_5)

# group: Importazione/Esportazione CSV > Rivedi
# Verifica l'estrazione delle intestazioni
watch_intestazioni = Watch(deconstruct_2.first)

# group: Definizioni parole chiave
# Impostazioni modificabili dall'utente che definiscono le regole di denominazione aziendali utilizzate dai controlli (maiuscole, parole chiave e separatore obbligatorio). Aggiornarle in modo che corrispondano al progetto o allo standard aziendale
toUpper = String.ToUpper(string=clean_2)
code_block = CodeBlock { "-"; }
code_block_2 = CodeBlock()
# ---------- code_block_2.designscript (2 lines) ----------
// one output list
["GA","DET","STRUCT"];
# ----------------------------------------
code_block_3 = CodeBlock { 0; }
code_block_4 = CodeBlock { 1; }
code_block_5 = CodeBlock { 2; }

# group: Importazione/Esportazione CSV > Controlli regole (maiuscole + separatore)
# Genera output di regole booleane per ciascun nome. Controlla se ogni nome è in maiuscolo e se contiene la stringa del separatore richiesta
eq = clean_2 == toUpper
contains = String.Contains(string=clean_2, searchFor=code_block)

# group: Importazione/Esportazione CSV > Controllo parole chiave (contiene qualsiasi parola chiave)
# Controlla se ogni nome contiene almeno una parola chiave approvata. Genera un elenco booleano in cui ogni elemento corrisponde al nome associato.
getItemAtIndex_3 = List.GetItemAtIndex(list=code_block_2, index=code_block_3)
contains_2 = String.Contains(string=clean_2, searchFor=getItemAtIndex_3)
getItemAtIndex_4 = List.GetItemAtIndex(list=code_block_2, index=code_block_4)
contains_3 = String.Contains(string=clean_2, searchFor=getItemAtIndex_4)
or_ = Or(bool0=contains_2, bool1=contains_3)
getItemAtIndex_5 = List.GetItemAtIndex(list=code_block_2, index=code_block_5)
contains_4 = String.Contains(string=clean_2, searchFor=getItemAtIndex_5)
or_2 = Or(bool0=or_, bool1=contains_4)

# group: Importazione/Esportazione CSV > Combina controlli nella maschera finale
# Combina tutti gli output delle regole in un'unica maschera booleana finale utilizzando la logica AND. Questa maschera definisce se ogni nome è valido o meno.
and_ = And(bool0=eq, bool1=contains)
and_2 = And(bool0=and_, bool1=or_2)

# group: Importazione/Esportazione CSV > Nomi validi e non validi
# Output: divide l'elenco di nomi di input in risultati validi e non validi in base alla maschera finale
filterByBoolMask = List.FilterByBoolMask(list=clean_2, mask=and_2)

# group: Importazione/Esportazione CSV > Debug e riepilogo
# Controlli visivi per confermare input, regole e output
nomi_validi = Watch(filterByBoolMask.in)
invalid_names = Watch(filterByBoolMask.out)

# group: Importazione/Esportazione CSV > Esporta in CSV
# Esporta i gruppi di nomi validi
percorso_file_3 = Filename("..\..\..\..\..\..\Desktop\CSV_Export_Example")
exportCSV = Data.ExportCSV(filePath=percorso_file_3, data=filterByBoolMask.in)

# group: Importazione/Esportazione da/in Excel > Revisione/Pavimento raggruppato
# Anteprima dei valori del pavimento raggruppati dopo il clustering della somiglianza. Utilizzata per verificare il raggruppamento corretto e la coerenza dei nomi
watch_2 = Watch(groupBySimilarity.groupedValues)

# group: Importazione/Esportazione da/in Excel > Revisione/Pavimento raggruppato
# Anteprima dei valori del pavimento raggruppati dopo il clustering della somiglianza. Utilizzata per verificare il raggruppamento corretto e la coerenza dei nomi
watch_3 = Watch(groupBySimilarity.groupedIndices)

# group: Importazione/Esportazione da/in Excel
# Questo script importa i dati strutturati da Excel, li elabora e li riorganizza in base a regole definite ed esporta il risultato trasformato per uso esterno. In questo workflow, un elenco di locali viene importato, analizzato e riordinato in base alla posizione, raggruppando i locali in elenchi strutturati in base a criteri spaziali. I dati elaborati vengono quindi esportati per essere utilizzati nel coordinamento e nella generazione di rapporti.
integer_slider = IntegerSlider(1, range=0..2 step 1)

# group: Importazione/Esportazione da/in Excel > Inserisci intestazioni prima dell'esportazione (facoltativo)
# Inserisce una riga di intestazione all'inizio dei dati esportati.
# note: Utilizza GroupedIndices per estrarre le righe originali
getItemAtIndex_6 = List.GetItemAtIndex(list=clean, index=groupBySimilarity.groupedIndices)
flatten = List.Flatten(list=getItemAtIndex_6, amount=integer_slider)
integer_slider_2 = IntegerSlider(0, range=0..2 step 1)
# note: Inserisce le intestazioni all'indice 0 prima dell'esportazione
insert = List.Insert(list=flatten, element=deconstruct.first, index=integer_slider_2)

# group: Importazione/Esportazione da/in Excel > Revisione/Strutture righe raggruppate
# Controlla la struttura delle righe nidificate prima della riduzione della nidificazione e dell'esportazione
watch_4 = Watch(insert)

# group: Importazione/Esportazione da/in Excel > Esporta in Excel
# Esporta i dati di Dynamo strutturati in un file Excel (.xlsx). Supporta gli output per la revisione esterna e l'integrazione con altri strumenti
# note: Il nome del file di esportazione deve terminare con .xlsx
# Se esiste già un file con lo stesso nome e l'opzione Sovrascrivi è impostata su false, l'esportazione non verrà eseguita e non verrà creato alcun nuovo file.
# Per sostituire un file esistente, è necessario attivare l'opzione Sovrascrivi.
percorso_file_4 = Filename("..\..\..\..\..\..\Desktop\Excel_Export_Example.xlsx")
string_2 = StringInput("\"Export sheet\"")
integer_slider_3 = IntegerSlider(0, range=0..100 step 1)
booleano_6 = BoolSelector(true)
openXMLExportExcel = Data.OpenXMLExportExcel(filePath=percorso_file_4, sheetName=string_2, data=insert, startRow=integer_slider_3, startColumn=integer_slider_3, writeAsString=booleano_6)

# group: Importazione/Esportazione geometria > Importazione geometria
# Importa la geometria da un file SAT in Dynamo e la converte in curve, superfici e solidi modificabili per i workflow di trasformazione
percorso_file_5 = Filename("..\..\..\..\..\..\Desktop\Geometry_Import_Example.sat")
file_from_path = FileObject(path=percorso_file_5)
units = Units("Metri")
# note: Importa il file come solidi/superfici/curve di Dynamo.
importFromSATWithUnits = Geometry.ImportFromSATWithUnits(file_filePath=file_from_path, dynamoUnit=units)
watch_3d_anteprima_della = Watch3D(importFromSATWithUnits)  # "Watch 3D (anteprima della geometria importata)"

# group: Importazione/Esportazione geometria > Gruppo di debug/apprendimento
# Mostra ciò che Dynamo ritiene che ogni elemento sia (solido, superficie, curva, ecc.)
# Utile se le importazioni si comportano in modo imprevisto.
type = Object.Type(object=importFromSATWithUnits)
watch_5 = Watch(type)

# group: Importazione/Esportazione geometria > Trasforma
# Mette in scala la geometria importata secondo un fattore uniforme.
XY = Plane.XY()
code_block_6 = CodeBlock { 5; }
scale = Geometry.Scale(geometry=importFromSATWithUnits, plane=XY, xamount=code_block_6, yamount=code_block_6, zamount=code_block_6)

# group: Importazione/Esportazione geometria > Esporta in SAT
# Esportare la geometria aggiornata come file SAT. Il file SAT può essere importato in Autocad, Revit e così via.
percorso_file_6 = Filename("..\..\..\..\..\..\Desktop\Geometry_Export_Example.sat")
exportToSAT = Geometry.ExportToSAT(geometry=scale, filePath=percorso_file_6)
watch_3d_anteprima_della_2 = Watch3D(scale)  # "Watch 3D (anteprima della geometria in scala)"
