# Dynamo graph Make a Custom Node.dyn "Crea un nodo personalizzato" (Dynamo 3.0.3.7597)
# author: Dynamo
# Questo documento consentirà di acquisire familiarità con la creazione di un nodo personalizzato.

# group: Informazioni sul grafico
# Metadati, legenda dei codici colore, regole di denominazione
# note: PROGETTO DI DYNAMO
# Crea un nodo personalizzato
# note: VERSIONE DI DYNAMO
# 4.2.0
# note: VERSIONE DELL'APPLICAZIONE HOST
# N/A
# note: FILE ASSOCIATI
# Curve_Validate.dyf
# note: PACCHETTI DI DYNAMO RICHIESTI
# N/A
# note: AUTORI/DATA DI CREAZIONE
# Archilizer per il team di Dynamo/4 febbraio 2026
# note: COMMENTI AGGIUNTIVI
# I nodi personalizzati si trovano in genere nella sezione Moduli aggiuntivi della libreria.
# Questo nodo personalizzato si trova in:
# Moduli aggiuntivi → Modelli → Curva → Curve_Validate
# Se non viene visualizzato:
# Verificare che il file .dyf si trovi nella cartella dei nodi personalizzati
# Accedere a:
# Pacchetti → Package Manager → Impostazioni pacchetto → Percorsi di ricerca di pacchetti/librerie.
# Verificare che il percorso della cartella sia presente nell'elenco o aggiungere un nuovo percorso.
# Riavviare Dynamo dopo l'aggiunta di nuovi nodi personalizzati.
# note: DESCRIZIONE
# Questo documento consentirà di acquisire familiarità con la creazione di nodi personalizzati.
# Per mantenere gli script di Dynamo ordinati e leggibili, è consigliabile seguire una chiara
# struttura durante la creazione di grafici.
# Ulteriori informazioni sono disponibili nella pagina di Dynamo Primer sulla creazione di un nodo personalizzato:
# https://primer2.dynamobim.org/it/6_custom_nodes_and_packages/6-1_custom-nodes/2-creating

# group: ALL'INTERNO DEL NODO PERSONALIZZATO
# note: Questo script verifica e filtra la geometria della curva utilizzando semplici regole. Accetta curve di input come linee, archi e così via, e verifica che ogni oggetto esista, che sia una curva valida, che soddisfi una condizione di apertura o chiusura facoltativa e che sia più lungo della lunghezza minima scelta. Il nodo genera quindi curve valide, curve non valide e una maschera di convalida booleana che mostra quali curve hanno superato o meno i controlli, semplificando la correzione della geometria, evitando errori nei passaggi successivi e preparando i dati per un'ulteriore elaborazione in Dynamo.

# group: Rivedi
# OUTPUT DI DEBUG E CONTROLLO, UTILIZZATI PER VERIFICARE I RISULTATI SENZA INFLUIRE SUGLI OUTPUT PRINCIPALI
# note: USO: controlli leggibili dall'utente in modo da poter verificare che il grafico funzioni come previsto, senza modificare i risultati come nodi Watch, List.Count, stringhe di riepilogo, flag "PASS/FAIL", elenchi di errori, geometria di anteprima (Watch 3D), output di esempio.

# group: Annotazioni
# note: USO:
# PER COMMENTI E INFORMAZIONI SULLO SCRIPT.

# group: Output
# RISULTATI FINALI PRODOTTI DAL GRAFICO, PRONTI PER L'ESPORTAZIONE O L'UTILIZZO A VALLE
# note: USO: risultati finali da utilizzare a valle (esportati, inseriti in un altro grafico), ad esempio elenchi finali, stringhe formattate, valori calcolati, dizionari/tabelle e dati pronti per l'esportazione.

# group: Input
# VALORI CONTROLLATI DALL'UTENTE CHE DEFINISCONO I DATI E LE IMPOSTAZIONI DI DESTINAZIONE PRIMA DELL'ELABORAZIONE.
# note: USO: tutti i valori controllati dall'utente che definiscono cosa verrà elaborato dal grafico e come dovrebbe comportarsi,
# come dispositivi di scorrimento numerici, stringhe, percorsi di file, pulsanti di commutazione booleani, menu a discesa, elenchi iniziali.

# group: Azioni
# OPERAZIONI PRINCIPALI CHE ELABORANO GLI INPUT
# note: USO: la pipeline di elaborazione principale che trasforma gli input in risultati. È qui che avviene il "lavoro" come la pulizia degli elenchi, la mappatura, il filtraggio, la logica delle stringhe, le operazioni geometriche, la formattazione e le conversioni.

# group: ALL'INTERNO DEL NODO PERSONALIZZATO > Input
# "Utilizzare questi controlli per definire il significato di "valido".
# Le curve possono essere un elenco di linee, archi, PolyCurve o tipi di curva misti.
# Utilizzare flattenDepth per controllare la modalità di gestione degli elenchi nidificati.
number = DoubleInput(5)
number_2 = DoubleInput(10)
number_3 = DoubleInput(15)
byCoordinates = Point.ByCoordinates(x=number, y=number_2, z=number_3)
byCoordinates_2 = Point.ByCoordinates(x=number_3, y=number, z=number_2)
byCoordinates_3 = Point.ByCoordinates(x=number_2, y=number_3, z=number)
list_create = List.Create(item0=byCoordinates, item1=byCoordinates_2, item2=byCoordinates_3)
byPoints = NurbsCurve.ByPoints(punti=list_create)
number_4 = DoubleInput(1)

# group: ALL'INTERNO DEL NODO PERSONALIZZATO > Convalida dei valori null e dei tipi
# Filtra i valori null e gli oggetti non curvi prima di eseguire i controlli della geometria della curva.
# In questo modo si evita la visualizzazione di avvisi e si rende il nodo più sicuro per gli input misti.
flatten = List.Flatten(list=byPoints, amount=number_4)
type = Object.Type(object=flatten)
isNull = Object.IsNull(object=flatten)
not_ = Not(x=isNull)

# group: ALL'INTERNO DEL NODO PERSONALIZZATO > Tipo di geometria da considerare
# Geometria simile ad una curva
string = StringInput("Linea")
booleano = BoolSelector(true)
contains = String.Contains(string=type, searchFor=string, ignoreCase=booleano)
string_2 = StringInput("Curva")
contains_2 = String.Contains(string=type, searchFor=string_2, ignoreCase=booleano)
string_3 = StringInput("Arco")
contains_3 = String.Contains(string=type, searchFor=string_3, ignoreCase=booleano)
string_4 = StringInput("PolyCurve")
contains_4 = String.Contains(string=type, searchFor=string_4, ignoreCase=booleano)
or_ = Or(bool0=contains, bool1=contains_2, bool2=contains_3, bool3=contains_4)

# group (continued): ALL'INTERNO DEL NODO PERSONALIZZATO > Convalida dei valori null e dei tipi
and_ = And(bool0=or_, bool1=not_)
filterByBoolMask = List.FilterByBoolMask(list=flatten, mask=and_)

# group: ALL'INTERNO DEL NODO PERSONALIZZATO > Input
# Utilizzare questi controlli per definire il significato di "valido".
# minLength è una soglia di lunghezza minima della curva.
# Impostare requireClosed su true se le curve devono essere chiuse (linee chiuse)
number_5 = DoubleInput(5)
booleano_2 = BoolSelector(false)

# group: ALL'INTERNO DEL NODO PERSONALIZZATO > Controlli geometria (lunghezza e chiusura)
# Applica le regole della curva:
# La lunghezza deve essere ≥ minLength
# Se requireClosed è true, la curva deve essere chiusa
length = Curve.Length(curve=filterByBoolMask.in)
# note: Le curve più corte di MinLength non sono valide.
ge = length >= number_5
isClosed = Curve.IsClosed(curve=filterByBoolMask.in)
booleano_3 = BoolSelector(true)
if_ = RefactoredIf(test=booleano_2, true=isClosed, false=booleano_3)
and_2 = And(bool0=ge, bool1=if_)

# group: ALL'INTERNO DEL NODO PERSONALIZZATO > Dividi curve valide e non valide
# Utilizza la maschera booleana finale per separare le curve in elenchi validi e non validi.
filterByBoolMask_2 = List.FilterByBoolMask(list=filterByBoolMask.in, mask=and_2)

# group: ALL'INTERNO DEL NODO PERSONALIZZATO > Output
# validCurves: curve che hanno superato la convalida
# invalidCurves: curve che non hanno superato la convalida
# maskValid: maschera booleana per il filtraggio altrove
code_block = CodeBlock(maskValid=and_2)
# ---------- code_block.designscript (4 lines) ----------
// Boolean mask of validation results
 // true  = valid curve
 // false = invalid curve
 maskValid : bool[]..[];
# ----------------------------------------
code_block_2 = CodeBlock(invalidCurves=filterByBoolMask_2.out)
# ---------- code_block_2.designscript (3 lines) ----------
// Curves that failed validation
 // These should not be used for modelling
 invalidCurves : var[]..[];
# ----------------------------------------
code_block_3 = CodeBlock(validCurves=filterByBoolMask_2.in)
# ---------- code_block_3.designscript (3 lines) ----------
// Curves that passed all validation checks
 // These are safe to use for modelling and automation
 validCurves : var[]..[];
# ----------------------------------------

# group: Input
# "Utilizzare questi controlli per definire il significato di "valido".
# Le curve possono essere un elenco di linee, archi, PolyCurve o tipi di curva misti.
# Utilizzare flattenDepth per controllare la modalità di gestione degli elenchi nidificati
number_6 = DoubleInput(5)
booleano_4 = BoolSelector(false)
number_7 = DoubleInput(5)
number_8 = DoubleInput(10)
number_9 = DoubleInput(15)
byCoordinates_4 = Point.ByCoordinates(x=number_7, y=number_8, z=number_9)
byCoordinates_5 = Point.ByCoordinates(x=number_9, y=number_7, z=number_8)
byCoordinates_6 = Point.ByCoordinates(x=number_8, y=number_9, z=number_7)
list_create_2 = List.Create(item0=byCoordinates_4, item1=byCoordinates_5, item2=byCoordinates_6)
byPoints_2 = NurbsCurve.ByPoints(punti=list_create_2)
number_10 = DoubleInput(1)

# group: NODO PERSONALIZZATO
# Fare doppio clic sul nodo per espanderlo e aprire il file .dyf.
# note: Questa logica viene compressa come un nodo personalizzato per rendere il controllo delle curve semplice, riutilizzabile e coerente tra diversi grafici di Dynamo. Invece di ricostruire ogni volta gli stessi passaggi di convalida, le regole sono contenute in uno strumento chiaro che può essere riutilizzato, aggiornato e condiviso facilmente. Ciò riduce gli errori, mantiene i grafici ordinati e leggibili
curve_Validate = Custom[Curve_Validate](minLength=number_6, requireClosed=booleano_4, curveLikeGeometry=byPoints_2, flattenDepth=number_10)  # Convalida la geometria della curva controllando i valori null, il tipo, la tolleranza di lunghezza e la chiusura facoltativa. Restituisce curve valide/non valide, maschera booleana e motivi dell'errore.

# group: Output
# Mostra le curve valide, le curve non valide e la maschera di convalida.
watch = Watch(curve_Validate.invalidCurves)
watch_2 = Watch(curve_Validate.validCurves)
watch_3 = Watch(curve_Validate.maskValid)
