# Dynamo graph Create a Graph.dyn "グラフを作成" (Dynamo 4.0.0.3076)
# author: Dynamo
# このドキュメントは、標準化されたワークフローと次の重要な手順に慣れるのに役立ちます。

# group: DYNAMO グラフの作成方法 > 例
# note: 名前ジェネレーター

# group: グループの命名規則 入力 → アクション → 出力 → レビュー > 入力
# 処理が行われる前にターゲット データと設定を定義するユーザー コントロール値
# note: 用途: グラフが処理する対象と動作方法を定義する、すべてのユーザー コントロール値。
# 例: 数値スライダ、文字列、ファイル パス、ブール値切り替え、ドロップダウン、初期リスト。

# group: グループの命名規則 入力 → アクション → 出力 → レビュー > アクション
# 入力を処理する主要な演算
# note: 用途: 入力を結果に変換するメインの処理パイプライン。ここで、リストのクリーンアップ、マッピング、フィルタリング、文字列ロジック、ジオメトリ操作、フォーマット、変換などの「作業」が行われます。

# group: グループの命名規則 入力 → アクション → 出力 → レビュー > 出力
# グラフによって生成された最終結果で、書き出しまたは下流での使用の準備が整っています
# note: 用途: 最終リスト、書式設定された文字列、計算値、ディクショナリ/テーブル、書き出し可能なデータなど、下流で使用(書き出し、別のグラフへの接続)されることを意図した最終結果

# group: グループの命名規則 入力 → アクション → 出力 → レビュー > 確認
# 出力のデバッグとチェック。メインの出力に影響を与えずに結果を確認するために使用されます
# note: 用途: Watch ノード、List.Count、概要文字列、「PASS/FAIL」フラグ、エラー リスト、プレビュー ジオメトリ(Watch3D)、サンプル出力などの結果を変更せずに、グラフが期待どおりに動作していることを確認するための、人間が解読可能なチェック。

# group: グループの命名規則 入力 → アクション → 出力 → レビュー > 注釈
# note: 用途:
# コメントおよびスクリプト情報用

# group: グラフ情報
# メタデータ、色コード凡例、命名規則
# note: DYNAMO プロジェクト
# グラフを作成
# note: DYNAMO VERSION
# 4.2.0
# note: ホスト アプリケーションのバージョン
# N/A
# note: 関連ファイル
# N/A
# note: 必要な DYNAMO パッケージ
# N/A
# note: 作成者/作成日
# Archilizer for Dynamo Team / Feb. 4 2026
# note: その他のコメント
# N/A
# note: 説明
# このドキュメントは、標準化されたワークフローと次の重要な手順に慣れるのに役立ちます

# group: DYNAMO グラフの作成方法 > グラフ情報
# メタデータ、色コード凡例、命名規則
# note: DYNAMO プロジェクト
# 「グラフ ファイルの命名規則」を参照してください
# note: DYNAMO バージョン
# note: ホスト アプリケーションのバージョン
# note: 関連ファイル
# note: 必要な DYNAMO パッケージ
# note: 作成者/作成日
# note: その他のコメント
# note: 説明
# グラフの説明は次を記述します
# グラフの機能、使用データ、
# 適用されるルール、出力、
# 実行される場所と方法(ホスト アプリ + バージョン)、主要な制限

# group: DYNAMO グラフの作成方法 > Dynamo プレーヤ 入力 → アクション → 出力
# Dynamo プレーヤを使用すると、Dynamo インタフェースを開かずに Dynamo グラフを実行できます。
# ユーザーは定義済みの入力のみと対話し、スクリプトを実行します
# note: 入力ノードを右クリックし、[入力]を選択します
your_input = StringInput("Dynamo player")  # graph input
アクション = String.ToUpper(string=your_input)
# note: 入力ノードを右クリックし、[出力]を選択します
your_output = Watch(アクション)  # graph output

# group: DYNAMO グラフの作成方法 > ノードの命名規則
# note: ノード名全体を変更しないでください。代わりに、末尾に括弧を使用します。
文字列 = StringInput("")
# note: 実行
文字列_入力_1 = StringInput("")
# note: 実行しない
# note: オフィスの標準に基づいてこれらのルールを更新
入力_1 = StringInput("")
一般的な_do_do_not_ルール = CodeBlock()
# ---------- 一般的な_do_do_not_ルール.designscript (12 lines) ----------
/*
Do:
Rename key nodes only (inputs, rules, outputs, decision logic)
Use notes to add context to your script
Use capitalization consistently (e.g. Title Case or camelCase, not mixed)
*/

/*Do Not:
Rename every node in the graph
Leave important nodes with default names if they affect logic
Use vague names like "Data", "Stuff", "Fix", "Test"
*/;
# ----------------------------------------

# group: DYNAMO グラフの作成方法 > グラフ ファイルの命名規則
# グラフの目的や目的の用途を名前から把握できるよう、BIM 実行計画の規則に似た命名パターンに従うことをお勧めします:
string = StringInput("-")
組織 = CodeBlock { "AUT"; }
関数フィールド = CodeBlock { BLD  = "BLD"; STR  = "STR"; MEP  = "MEP"; INFR = "INFR"; }
説明 = CodeBlock { "Logical_description"; }
dynamo_バージョン = CodeBlock { "D303"; }
script_version_バックアップ_ファイルの場合のみ = CodeBlock { "V2"; }
組立順序 = String.Join(separator=string, string0=組織, string1=関数フィールド.BLD, string2=説明, string3=dynamo_バージョン, string4=script_version_バックアップ_ファイルの場合のみ)
名前の例 = Watch(組立順序)
# note: 推奨される命名構造
命名構造 = CodeBlock()
# ---------- 命名構造.designscript (3 lines) ----------
["Organisation  | Function fields | Description         | Dynamo-Version | Script-Version",
"AUT            |BLD              | Logical_description | D303           | V3"
];
# ----------------------------------------
# note: 編集しない:
# note: 関数フィールドは、スクリプトの主な作業領域/ドメインを記述します
関数フィールド_2 = CodeBlock()
# ---------- 関数フィールド_2.designscript (4 lines) ----------
BLD  = "BLD  — Building design";
STR  = "STR  — Structural design";
MEP  = "MEP  — Mechanical / Electrical / Plumbing";
INFR = "INFR — Infrastructure";
# ----------------------------------------

# group: DYNAMO グラフの作成方法
# 構造、命名、ベスト プラクティスのビジュアル ガイド
# note: キー チェックポイントでのみ Watch ノードを使用します
# 非アクティブ スクリプトをフリーズします
# note: グラフを実行する前に:
# 入力が設定されていることを確認します
# プレビュー/チェックを確認します
# Dynamo プレーヤを使用する前に、手動で 1 回実行します
# 正常に実行した後、ファイルを保存します
# note: このドキュメントは、標準化されたワークフローと次の重要な手順に慣れるのに役立ちます
# note: 背景/背面パネル
情報 = CodeBlock()
# ---------- 情報.designscript (5 lines) ----------
"To keep Dynamo graphs neat and readable, we recommend following a clear
structure.

For more information, read the Dynamo Primer page on best-practice graph strategies:
https://primer2.dynamobim.org/9_best_practices/1-graph-strategies";
# ----------------------------------------
