# Dynamo graph Import & Export Workflow.dyn "読み込み & 書き出しワークフロー" (Dynamo 4.0.0.3076)
# author: Dynamo
# このドキュメントは、Excel ファイルおよび csv ファイルの読み込みと書き出しのさまざまな方法に慣れるのに役立ちます。

# group: グラフ情報
# メタデータ、色コード凡例、命名規則
# note: DYNAMO プロジェクト
# 読み込み & 書き出しワークフロー
# note: DYNAMO VERSION
# 4.2.0
# note: ホスト アプリケーションのバージョン
# N/A
# note: 関連ファイル
# N/A
# note: 必要な DYNAMO パッケージ
# N/A
# note: 作成者/作成日
# Archilizer for Dynamo Team / Feb. 4 2026
# note: その他のコメント
# N/A
# note: 説明
# このドキュメントは、Excel ファイルおよび csvファイルの読み込みと書き出しのさまざまな方法に慣れるのに役立ちます。
# 一度に使用できる入力メソッドは 1 つだけです。使用されていないスクリプトをフリーズします。

# group: 確認
# 出力のデバッグとチェック。メインの出力に影響を与えずに結果を確認するために使用されます
# note: 用途: Watch ノード、List.Count、概要文字列、「PASS/FAIL」フラグ、エラー リスト、プレビュー ジオメトリ(Watch3D)、サンプル出力などの結果を変更せずに、グラフが期待どおりに動作していることを確認するための、人間が解読可能なチェック。

# group: 注釈
# note: 用途:
# コメントおよびスクリプト情報用。

# group: 出力
# グラフによって生成された最終結果で、書き出しまたは下流での使用の準備が整っています
# note: 用途: 最終リスト、書式設定された文字列、計算値、ディクショナリ/テーブル、書き出し可能なデータなど、下流で使用(書き出し、別のグラフへの接続)されることを意図した最終結果。

# group: 入力
# 処理が行われる前にターゲット データと設定を定義するユーザー コントロール値
# note: 用途: グラフが処理する対象と動作方法を定義する、すべてのユーザー コントロール値。
# 例: 数値スライダ、文字列、ファイル パス、ブール値切り替え、ドロップダウン、初期リスト。

# group: アクション
# 入力を処理する主要な演算
# note: 用途: 入力を結果に変換するメインの処理パイプライン。ここで、リストのクリーンアップ、マッピング、フィルタリング、文字列ロジック、ジオメトリ操作、フォーマット、変換などの「作業」が行われます。

# group: CSV の読み込み/書き出し
# このスクリプトは、CSV データを読み込み、定義された命名規則に基づいて分析および再構築し、確認と修正のために有効なエントリと無効なエントリを分離します。このワークフローでは、名前のリストはルールベースの検証ロジックを使用して処理され、命名規則に従って並べ替えられ、有効なグループと無効なグループに分類されます。有効な名前は、コーディネーションやレポートなど下流で使用するために書き出されます
# note: ヒント: 入力の後に Watch ノードを追加して、ファイルの読み込み方法を確認します

# group: Excel の読み込み/書き出し > Excel 読み込み
# Excel (.xlsx)ファイルから Dynamo にデータを読み込み、スプレッドシートの行と列を構造化されたリストに変換して、処理、検証、操作を行います。一般的な用途には、下流ワークフローの集計表、パラメータ、数量などがあります
# note: Click Browse and select your own Excel (.xlsx) file before running this graph
file_path = Filename("ファイルが選択されていません。")
string = StringInput("sheet1")
# note: 数値を読み取るときは false に設定します。
# テキストを読み取るときは true に設定します。
boolean = BoolSelector(false)
openXMLImportExcel = Data.OpenXMLImportExcel(filePath=file_path, sheetName=string, readAsString=boolean)
# note: List.Transpose ノードを使用して、リストの列を読み取ります。
# リストの行を読み取る場合は転置しません。
transpose = List.Transpose()  # unwired: lists

# group: Excel の読み込み/書き出し > Excel のデータ構造化
# Null または空のエントリを削除し、ヘッダを削除します
# note: ヘッダを取得
deconstruct = List.Deconstruct(list=openXMLImportExcel)
boolean_2 = BoolSelector(false)
clean = List.Clean(list=deconstruct.rest, preserveIndices=boolean_2)

# group: Excel の読み込み/書き出し > 類似性によるグループ化
# Excel のデータ操作の例
transpose_2 = List.Transpose(lists=clean)
code_block_列インデックス = CodeBlock { 1; }
# note: 1 つのキー列を抽出する場合にのみ使用されます
getItemAtIndex = List.GetItemAtIndex(list=transpose_2, index=code_block_列インデックス)
number = DoubleInput(0)
boolean_3 = BoolSelector(false)
groupBySimilarity = List.GroupBySimilarity(list=getItemAtIndex, tolerance=number, considerAdjacency=boolean_3)

# group: Excel の読み込み/書き出し > Floor 列の抽出
# 列インデックスを確認します
watch = Watch(getItemAtIndex)

# group: CSV の読み込み/書き出し > CSV 読み込み
# CSV データを Dynamo に読み込み、ルールベースの検証、並べ替え、分類ワークフロー用に構造化します
# note: Click Browse and select your own CSV (.csv) file before running this graph
file_path_2 = Filename("ファイルが選択されていません。")
boolean_4 = BoolSelector(true)
# note: 列を読み込む場合はリストを転置します。
# 行を読み込む場合はリストを転置しないでください
importCSV = Data.ImportCSV(filePath=file_path_2, transpose=boolean_4)

# group: CSV の読み込み/書き出し > CSV のデータ構造化
# データ構造化: 入力をマージおよびクリーンアップして、下流のルールが常に一貫した文字列のリストを受け取るようにします(NULL もネストされたリストもない、クリーンな形式)。
deconstruct_2 = List.Deconstruct(list=importCSV)
transpose_3 = List.Transpose(lists=deconstruct_2.rest)
code_block_読み込む列のインデックス = CodeBlock { 0; }
getItemAtIndex_2 = List.GetItemAtIndex(list=transpose_3, index=code_block_読み込む列のインデックス)
boolean_5 = BoolSelector(false)
clean_2 = List.Clean(list=getItemAtIndex_2, preserveIndices=boolean_5)

# group: CSV の読み込み/書き出し > レビュー
# ヘッダの抽出をチェックします
watch_ヘッダ = Watch(deconstruct_2.first)

# group: CSV の読み込み/書き出し > キーワードの定義
# チェックで使用されるオフィス命名規則を定義する、ユーザーが編集可能な設定(大文字、キーワード、および必要な区切り文字)。プロジェクトまたはオフィスの標準に合わせて更新します
# note: このリストをオフィスの命名規則に合わせて編集します
toUpper = String.ToUpper(string=clean_2)
code_block = CodeBlock { "-"; }
code_block_2 = CodeBlock()
# ---------- code_block_2.designscript (2 lines) ----------
// one output list
["GA","DET","STRUCT"];
# ----------------------------------------
code_block_3 = CodeBlock { 0; }
code_block_4 = CodeBlock { 1; }
code_block_5 = CodeBlock { 2; }

# group: CSV の読み込み/書き出し > ルール チェック(大文字 + 区切り文字)
# 名前ごとにブール演算ルール出力を生成します。各名前が大文字であるかどうか、および必要な区切り文字が含まれているかどうかを確認します
eq = clean_2 == toUpper
contains = String.Contains(string=clean_2, searchFor=code_block)

# group: CSV の読み込み/書き出し > キーワード チェック(任意のキーワードを含む)
# 各名前に少なくとも 1 つの承認済みキーワードが含まれているかどうかを確認します。各項目が一致する名前に対応するブール値のリストを出力します。
getItemAtIndex_3 = List.GetItemAtIndex(list=code_block_2, index=code_block_3)
contains_2 = String.Contains(string=clean_2, searchFor=getItemAtIndex_3)
getItemAtIndex_4 = List.GetItemAtIndex(list=code_block_2, index=code_block_4)
contains_3 = String.Contains(string=clean_2, searchFor=getItemAtIndex_4)
or_ = Or(bool0=contains_2, bool1=contains_3)
getItemAtIndex_5 = List.GetItemAtIndex(list=code_block_2, index=code_block_5)
contains_4 = String.Contains(string=clean_2, searchFor=getItemAtIndex_5)
or_2 = Or(bool0=or_, bool1=contains_4)

# group: CSV の読み込み/書き出し > 最終マスクにチェックを結合
# AND ロジックを使用して、すべてのルール出力を 1 つの最終的なブール演算マスクに結合します。このマスクは、それぞれの名前が有効か無効かを定義します。
and_ = And(bool0=eq, bool1=contains)
and_2 = And(bool0=and_, bool1=or_2)

# group: CSV の読み込み/書き出し > 有効な名前と無効な名前
# 出力: 最終マスクに基づいて、入力名リストを有効と無効の結果に分割します
filterByBoolMask = List.FilterByBoolMask(list=clean_2, mask=and_2)

# group: CSV の読み込み/書き出し > デバッグと概要
# 入力、ルール、および出力を確認するための視覚的チェック
有効な名前 = Watch(filterByBoolMask.in)
無効な名前 = Watch(filterByBoolMask.out)

# group: CSV の読み込み/書き出し > CSV に書き出し
# 名前の検証セットを書き出します
file_path_3 = Filename("ファイルが選択されていません。")
exportCSV = Data.ExportCSV(filePath=file_path_3, data=filterByBoolMask.in)

# group: Excel の読み込み/書き出し > レビュー/グループ化された Floor
# 類似性クラスタリング後のグループ化された Floor 値のプレビュー。正確なグループ化と名前の一貫性を検証するために使用されます
watch_2 = Watch(groupBySimilarity.groupedValues)

# group: Excel の読み込み/書き出し > レビュー/グループ化された Floor
# 類似性クラスタリング後のグループ化された Floor 値のプレビュー。正確なグループ化と名前の一貫性を検証するために使用されます
watch_3 = Watch(groupBySimilarity.groupedIndices)

# group: Excel の読み込み/書き出し
# このスクリプトは、Excel から構造化データを読み込み、定義されたルールに基づいて構造化データを処理および再編成し、変換された結果を外部で使用するために書き出します。このワークフローでは、部屋のリストが読み込まれ、分析され、場所ごとに並べ替えられ、空間条件に基づいて部屋が構造化されたリストにグループ化されます。処理されたデータは、コーディネーションとレポートで使用するために書き出されます。
integer_slider = IntegerSlider(1, range=0..2 step 1)

# group: Excel の読み込み/書き出し > 書き出し前にヘッダを挿入(オプション)
# 書き出されたデータの先頭にヘッダ行を挿入します。
# note: GroupedIndices を使用して元の行をプルします
getItemAtIndex_6 = List.GetItemAtIndex(list=clean, index=groupBySimilarity.groupedIndices)
flatten = List.Flatten(list=getItemAtIndex_6, amount=integer_slider)
integer_slider_2 = IntegerSlider(0, range=0..2 step 1)
# note: 書き出す前にインデックス 0 にヘッダを挿入します
insert = List.Insert(list=flatten, element=deconstruct.first, index=integer_slider_2)

# group: Excel の読み込み/書き出し > レビュー/グループ化された行の構造
# フラット化および書き出し前にネストされた行構造をチェックします
watch_4 = Watch(insert)

# group: Excel の読み込み/書き出し > Excel に書き出し
# 構造化された Dynamo データを Excel (.xlsx)に書き出します。外部でのレビューや他のツールとの統合のための出力をサポートします
# note: 書き出しファイル名の末尾は .xlsx でなければなりません
# 同じ名前のファイルが既に存在し、[上書き]が false に設定されている場合、書き出しは失敗し、新しいファイルは作成されません。
# 既存のファイルを置き換えるには、[上書き]を有効にする必要があります。
ファイル_パス = Filename("ファイルが選択されていません。")
string_2 = StringInput("\"Export sheet\"")
integer_slider_3 = IntegerSlider(0, range=0..100 step 1)
boolean_6 = BoolSelector(true)
openXMLExportExcel = Data.OpenXMLExportExcel(filePath=ファイル_パス, sheetName=string_2, data=insert, startRow=integer_slider_3, startColumn=integer_slider_3, writeAsString=boolean_6)

# group: ジオメトリの読み込み/書き出し > ジオメトリの読み込み
# SAT ファイルから Dynamo にジオメトリを読み込み、変換ワークフロー用に編集可能な曲線、サーフェス、ソリッドに変換します
# note: Click Browse and select your own SAT (.sat) file before running this graph
file_path_4 = Filename("ファイルが選択されていません。")
パスからのファイル = FileObject(path=file_path_4)
units = Units("Meters")
# note: ファイルを Dynamo ソリッド/サーフェス/曲線として読み込みます
importFromSATWithUnits = Geometry.ImportFromSATWithUnits(file_filePath=パスからのファイル, dynamoUnit=units)
watch_3d_読み込んだジオメトリのプレビュー = Watch3D(importFromSATWithUnits)

# group: ジオメトリの読み込み/書き出し > デバッグ/学習グループ
# Dynamo が各項目(ソリッド、サーフェス、曲線など)をどのように認識しているかを示します。
# 読み込みが予期せぬ動作をする場合に便利です。
type = Object.Type(object=importFromSATWithUnits)
watch_5 = Watch(type)

# group: ジオメトリの読み込み/書き出し > 変換
# 読み込まれたジオメトリを均一な係数でスケールします
XY = Plane.XY()
code_block_6 = CodeBlock { 5; }
scale = Geometry.Scale(geometry=importFromSATWithUnits, plane=XY, xamount=code_block_6, yamount=code_block_6, zamount=code_block_6)

# group: ジオメトリの読み込み/書き出し > SAT に書き出し
# 更新したジオメトリを SAT ファイルとして書き出します。SAT ファイルは、Autocad、Revit などに読み込むことができます。
file_path_5 = Filename("ファイルが選択されていません。")
exportToSAT = Geometry.ExportToSAT(geometry=scale, filePath=file_path_5)
watch_3d_スケールされたジオメトリをプレビュー = Watch3D(scale)
