# Dynamo graph Make a Custom Node.dyn "カスタム ノードを作成" (Dynamo 3.0.3.7597)
# author: Dynamo
# このドキュメントは、カスタム ノードの作成に慣れるのに役立ちます。

# group: グラフ情報
# メタデータ、色コード凡例、命名規則
# note: DYNAMO プロジェクト
# カスタム ノードを作成
# note: DYNAMO バージョン
# 4.1.0
# note: ホスト アプリケーションのバージョン
# N/A
# note: ASSOCIATED FILE(S)
# Curve_Validate.dyf
# note: 必要な DYNAMO パッケージ
# N/A
# note: 作成者/作成日
# Archilizer for Dynamo Team / Feb. 4 2026
# note: ADDITIONAL COMMENTS
# Custom nodes are typically found in the Add-ons section of the Library.
# This custom node is located under:
# Add-ons → Templates → Curve → Curve_Validate
# If it does not appear:
# Check that the .dyf file is in your custom nodes folder
# Go to:
# Packages → Package Manager → Package Settings → Package/Library Search Paths
# Verify the folder path is listed or add a new path
# Restart Dynamo after adding new custom nodes
# note: 説明
# このドキュメントは、カスタム ノードの作成に慣れるのに役立ちます。
# Dynamo スクリプトを整った読み取りやすい状態に保つには、グラフ作成の際に
# 明確な構造を使用することをお勧めします。
# 詳細については、Dynamo Primer のカスタム ノード作成のページを参照してください。
# https://primer2.dynamobim.org/ja/6_custom_nodes_and_packages/6-1_custom-nodes/2-creating

# group: カスタム ノード内
# note: このスクリプトは、単純なルールを使用して曲線ジオメトリをチェックし、フィルタリングします。線分、円弧などの入力曲線を受け取って、各オブジェクトが存在し、有効な曲線であり、オプションの開いた状態または閉じた状態を満たし、選択した最小長さよりも長いことを確認します。その後、ノードは有効な曲線、無効な曲線、およびチェックに合格した曲線と不合格だった曲線を示すブール演算検証マスクを出力します。これにより、ジオメトリのクリーンアップ、後の手順でのエラーの回避、Dynamo での以降の処理のためのデータの準備が容易になります。

# group: 確認
# 出力のデバッグとチェック。メインの出力に影響を与えずに結果を確認するために使用されます
# note: 用途: Watch ノード、List.Count、概要文字列、「PASS/FAIL」フラグ、エラー リスト、プレビュー ジオメトリ(Watch3D)、サンプル出力などの結果を変更せずに、グラフが期待どおりに動作していることを確認するための、人間が解読可能なチェック。

# group: 注釈
# note: 用途:
# コメントおよびスクリプト情報用。

# group: 出力
# グラフによって生成された最終結果で、書き出しまたは下流での使用の準備が整っています
# note: 用途: 最終リスト、書式設定された文字列、計算値、ディクショナリ/テーブル、書き出し可能なデータなど、下流で使用(書き出し、別のグラフへの接続)されることを意図した最終結果。

# group: 入力
# 処理が行われる前にターゲット データと設定を定義するユーザー コントロール値
# note: 用途: グラフが処理する対象と動作方法を定義する、すべてのユーザー コントロール値。
# 例: 数値スライダ、文字列、ファイル パス、ブール値切り替え、ドロップダウン、初期リスト。

# group: アクション
# 入力を処理する主要な演算
# note: 用途: 入力を結果に変換するメインの処理パイプライン。ここで、リストのクリーンアップ、マッピング、フィルタリング、文字列ロジック、ジオメトリ操作、フォーマット、変換などの「作業」が行われます。

# group: カスタム ノード内 > 入力
# これらのコントロールを使用して、「有効」の意味を定義します。
# 曲線は、線分、円弧、ポリカーブ、または混合曲線タイプのリストです。
# ネストされたリストの処理方法をコントロールするには、flattenDepth を使用します。
number = DoubleInput(5)
number_2 = DoubleInput(10)
number_3 = DoubleInput(15)
byCoordinates = Point.ByCoordinates(x=number, y=number_2, z=number_3)
byCoordinates_2 = Point.ByCoordinates(x=number_3, y=number, z=number_2)
byCoordinates_3 = Point.ByCoordinates(x=number_2, y=number_3, z=number)
list_create = List.Create(item0=byCoordinates, item1=byCoordinates_2, item2=byCoordinates_3)
byPoints = NurbsCurve.ByPoints(points=list_create)
number_4 = DoubleInput(1)

# group: カスタム ノード内 > Null および型の検証
# 曲線ジオメトリのチェックを実行する前に、NULL および非曲線オブジェクトをフィルタで除外します。
# これにより、警告が回避され、混合入力に対してノードを安全に保つことができます。
flatten = List.Flatten(list=byPoints, amount=number_4)
type = Object.Type(object=flatten)
isNull = Object.IsNull(object=flatten)
not_ = Not(x=isNull)

# group: カスタム ノード内 > 考慮すべきジオメトリのタイプ
# 曲線のようなジオメトリ
string = StringInput("Line")
boolean = BoolSelector(true)
contains = String.Contains(string=type, searchFor=string, ignoreCase=boolean)
string_2 = StringInput("Curve")
contains_2 = String.Contains(string=type, searchFor=string_2, ignoreCase=boolean)
string_3 = StringInput("Arc")
contains_3 = String.Contains(string=type, searchFor=string_3, ignoreCase=boolean)
string_4 = StringInput("PolyCurve")
contains_4 = String.Contains(string=type, searchFor=string_4, ignoreCase=boolean)
or_ = Or(bool0=contains, bool1=contains_2, bool2=contains_3, bool3=contains_4)

# group (continued): カスタム ノード内 > Null および型の検証
and_ = And(bool0=or_, bool1=not_)
filterByBoolMask = List.FilterByBoolMask(list=flatten, mask=and_)

# group: カスタム ノード内 > 入力
# これらのコントロールを使用して、「有効」の意味を定義します。
# minLength は、曲線の長さの最小しきい値です。
# 曲線を閉じる必要がある場合(ループ)は、requireClosed を true に設定します
number_5 = DoubleInput(5)
boolean_2 = BoolSelector(false)

# group: カスタム ノード内 > ジオメトリ チェック(長さと閉じ方)
# 次の曲線ルールを適用します。
# 長さは minLength 以上でなければなりません
# requireClosed が true の場合、曲線は閉じている必要があります
length = Curve.Length(curve=filterByBoolMask.in)
# note: MinLength より短いカーブは無効です。
ge = length >= number_5
isClosed = Curve.IsClosed(curve=filterByBoolMask.in)
boolean_3 = BoolSelector(true)
if_ = RefactoredIf(test=boolean_2, true=isClosed, false=boolean_3)
and_2 = And(bool0=ge, bool1=if_)

# group: カスタム ノード内 > 有効な曲線と無効な曲線を分割
# 最終的なブール演算マスクを使用して、曲線を有効リストと無効リストに分割します。
filterByBoolMask_2 = List.FilterByBoolMask(list=filterByBoolMask.in, mask=and_2)

# group: カスタム ノード内 > 出力
# validCurves: 検証に合格した曲線
# invalidCurves: 検証に合格しなかった曲線
# maskValid: 他の場所でフィルタリングするためのブール演算マスク
code_block = CodeBlock(maskValid=and_2)
# ---------- code_block.designscript (4 lines) ----------
// Boolean mask of validation results
 // true  = valid curve
 // false = invalid curve
 maskValid : bool[]..[];
# ----------------------------------------
code_block_2 = CodeBlock(invalidCurves=filterByBoolMask_2.out)
# ---------- code_block_2.designscript (3 lines) ----------
// Curves that failed validation
 // These should not be used for modelling
 invalidCurves : var[]..[];
# ----------------------------------------
code_block_3 = CodeBlock(validCurves=filterByBoolMask_2.in)
# ---------- code_block_3.designscript (3 lines) ----------
// Curves that passed all validation checks
 // These are safe to use for modelling and automation
 validCurves : var[]..[];
# ----------------------------------------

# group: 入力
# これらのコントロールを使用して、「有効」の意味を定義します。
# 曲線は、線分、円弧、ポリカーブ、または混合曲線タイプのリストです。
# ネストされたリストの処理方法をコントロールするには、flattenDepth を使用します
number_6 = DoubleInput(5)
boolean_4 = BoolSelector(false)
number_7 = DoubleInput(5)
number_8 = DoubleInput(10)
number_9 = DoubleInput(15)
byCoordinates_4 = Point.ByCoordinates(x=number_7, y=number_8, z=number_9)
byCoordinates_5 = Point.ByCoordinates(x=number_9, y=number_7, z=number_8)
byCoordinates_6 = Point.ByCoordinates(x=number_8, y=number_9, z=number_7)
list_create_2 = List.Create(item0=byCoordinates_4, item1=byCoordinates_5, item2=byCoordinates_6)
byPoints_2 = NurbsCurve.ByPoints(points=list_create_2)
number_10 = DoubleInput(1)

# group: カスタム ノード
# ノードをダブルクリックして展開し、dyf ファイルを開きます。
# note: このロジックは曲線のチェックを単純化するためにカスタム ノードとして圧縮され、再利用可能で、さまざまな Dynamo グラフ間で一貫性を持たせることができます。毎回同じ検証手順を再構築するのではなく、ルールを 1 つの明確なツールにまとめ、簡単に再利用、更新、共有できます。これにより、エラーが減り、グラフがクリーンで読みやすくなります
curve_Validate = Custom[Curve_Validate](minLength=number_6, requireClosed=boolean_4, curveLikeGeometry=byPoints_2, flattenDepth=number_10)  # NULL、タイプ、長さの許容差、およびオプションで閉じ方をチェックして、曲線ジオメトリを検証します。有効/無効な曲線、ブール演算マスク、失敗の理由を返します。

# group: 出力
# 有効な曲線、無効な曲線、および検証マスクを表示します。
watch = Watch(curve_Validate.invalidCurves)
watch_2 = Watch(curve_Validate.validCurves)
watch_3 = Watch(curve_Validate.maskValid)
