# Dynamo graph Create a Graph.dyn "그래프 작성" (Dynamo 4.0.0.3076)
# author: Dynamo
# 이 문서는 표준화된 워크플로우와 다음과 같은 중요한 단계를 익히는 데 도움이 됩니다.

# group: DYNAMO 그래프를 작성하는 방법 > 예
# note: 이름 생성기

# group: 그룹 명명 표준 입력 → 작업 → 출력 → 검토 > 입력
# 처리가 발생하기 전에 대상 데이터 및 설정을 정의하는 사용자 제어 값
# note: USE: 그래프에서 처리할 항목과 그래프 동작 방법을 정의하는 모든 사용자 제어 값입니다.
# 숫자 슬라이더, 문자열, 파일 경로, 부울 토글, 드롭다운, 초기 리스트 등이 해당됩니다.

# group: 그룹 명명 표준 입력 → 작업 → 출력 → 검토 > 작업
# 입력을 처리하는 핵심 작업입니다.
# note: USE: 입력을 결과로 변환하는 기본 처리 파이프라인. 여기서 리스트 정리, 매핑, 필터링, 문자열 논리, 형상 작업, 형식 지정, 변환과 같은 "작업"이 수행됩니다.

# group: 그룹 명명 표준 입력 → 작업 → 출력 → 검토 > 출력
# 그래프에 따라 생성된 최종 결과로, 내보내기 또는 다운스트림에 사용할 준비가 되어 있습니다.
# note: USE: 최종 리스트, 형식이 지정된 문자열, 계산된 값, 사전/테이블, 내보낼 준비된 데이터 등 다운스트림(내보내기 또는 다른 그래프에 연결)에 사용하기 위한 최종 결과

# group: 그룹 명명 표준 입력 → 작업 → 출력 → 검토 > 검토
# 결과를 디버그하고 검사합니다. 주 출력에 영향을 미치지 않고 결과를 확인하는 데 사용됩니다.
# note: USE: 사람이 읽을 수 있는 검사로, watch 노드, List.Count, 요약 문자열, "PASS/FAIL" 플래그, 오류 리스트, 형상 미리보기(Watch3D), 샘플 출력과 같은 결과를 변경하지 않고도 그래프가 예상대로 작동하는지 확인할 수 있습니다.

# group: 그룹 명명 표준 입력 → 작업 → 출력 → 검토 > 주석
# note: USE:
# 주석 및 스크립트 정보용

# group: 그래프 정보
# 메타데이터, 색상 코드 범례, 명명 규칙
# note: DYNAMO 프로젝트
# 그래프 작성
# note: DYNAMO VERSION
# 4.2.0
# note: 호스트 응용프로그램 버전
# 해당 없음
# note: 연관된 파일
# 해당 없음
# note: 필수 DYNAMO 패키지
# 해당 없음
# note: 작성자/작성 날짜
# Archilizer for Dynamo Team / 2026년 2월 4일
# note: 추가 해설
# 해당 없음
# note: 설명
# 이 문서는 표준화된 워크플로우와 다음과 같은 중요한 단계를 익히는 데 도움이 됩니다.

# group: DYNAMO 그래프를 작성하는 방법 > 그래프 정보
# 메타데이터, 색상 코드 범례, 명명 규칙
# note: DYNAMO 프로젝트
# 그래프 파일 명명 표준을 참고하십시오.
# note: DYNAMO 버전
# note: 호스트 응용프로그램 버전
# note: 연관된 파일
# note: 필수 DYNAMO 패키지
# note: 작성자/작성 날짜
# note: 추가 해설
# note: 설명
# 그래프 설명에는 다음과 같이 명시해야 합니다.
# 그래프의 역할, 그래프가 사용하는 데이터,
# 그래프에서 적용하는 규칙, 그래프 출력 내용,
# 그래프 실행 위치 및 방법(호스트 앱 + 버전)과 주요 제한 사항

# group: DYNAMO 그래프를 작성하는 방법 > Dynamo 플레이어 입력 → 작업 → 출력
# Dynamo 플레이어를 사용하면 Dynamo 인터페이스를 열지 않아도 Dynamo 그래프를 실행할 수 있습니다.
# 사용자는 미리 정의된 입력만 사용하여 상호 작용하고 스크립트를 실행합니다.
# note: 입력 노드를 마우스 오른쪽 버튼으로 클릭하고 "입력임"을 선택합니다.
사용자_입력 = StringInput("Dynamo 플레이어")  # graph input
작업 = String.ToUpper(문자열=사용자_입력)
# note: 입력 노드를 마우스 오른쪽 버튼으로 클릭하고 "출력임"을 선택합니다.
출력 = Watch(작업)  # graph output

# group: DYNAMO 그래프를 작성하는 방법 > 노드 명명 표준
# note: 전체 노드 이름을 변경하지 마십시오. 대신 끝에 괄호를 사용하십시오.
문자열 = StringInput("")
# note: 수행할 작업
문자열_입력_1 = StringInput("")
# note: 수행 금지 작업
# note: 사무실 표준에 따라 이러한 규칙 업데이트
입력_1 = StringInput("")
일반적인_수행_수행_금지_규칙 = CodeBlock()
# ---------- 일반적인_수행_수행_금지_규칙.designscript (12 lines) ----------
/*
Do:
Rename key nodes only (inputs, rules, outputs, decision logic)
Use notes to add context to your script
Use capitalization consistently (e.g. Title Case or camelCase, not mixed)
*/

/*Do Not:
Rename every node in the graph
Leave important nodes with default names if they affect logic
Use vague names like "Data", "Stuff", "Fix", "Test"
*/;
# ----------------------------------------

# group: DYNAMO 그래프를 작성하는 방법 > 그래프 파일 명명 표준
# 그래프의 이름을 보고 용도 또는 의도를 파악할 수 있도록 BIM 실행 계획의 규칙과 유사한 명명 패턴을 따르는 것이 좋습니다.
문자열_2 = StringInput("-")
조직 = CodeBlock { "AUT"; }
함수_필드 = CodeBlock { BLD  = "BLD"; STR  = "STR"; MEP  = "MEP"; INFR = "INFR"; }
설명 = CodeBlock { "Logical_description"; }
dynamo_버전 = CodeBlock { "D303"; }
script_version_백업_파일에만_해당 = CodeBlock { "V2"; }
조립_순서 = String.Join(구분_기호=문자열_2, string0=조직, string1=함수_필드.BLD, string2=설명, string3=dynamo_버전, string4=script_version_백업_파일에만_해당)
이름_예시 = Watch(조립_순서)
# note: 권장되는 명명 구조
명명_구조 = CodeBlock()
# ---------- 명명_구조.designscript (3 lines) ----------
["Organisation  | Function fields | Description         | Dynamo-Version | Script-Version",
"AUT            |BLD              | Logical_description | D303           | V3"
];
# ----------------------------------------
# note: 편집하지 않는 항목:
# note: 함수 필드는 스크립트의 기본 작업 영역/도메인을 설명합니다.
함수_필드_2 = CodeBlock()
# ---------- 함수_필드_2.designscript (4 lines) ----------
BLD  = "BLD  — Building design";
STR  = "STR  — Structural design";
MEP  = "MEP  — Mechanical / Electrical / Plumbing";
INFR = "INFR — Infrastructure";
# ----------------------------------------

# group: DYNAMO 그래프를 작성하는 방법
# 구조화, 이름 지정 및 활용 사례 시각적 가이드
# note: 키 체크포인트에서만 Watch 노드 사용
# 비활성 스크립트 고정
# note: 그래프 실행 전 할 일:
# 입력이 설정되었는지 확인
# 미리보기/검사 검토
# Dynamo 플레이어를 사용하기 전에 수동으로 한 번 실행
# 성공적인 실행 후 파일 저장
# note: 이 문서는 표준화된 워크플로우 및 다음과 같은 중요한 단계를 익히는 데 도움이 됩니다
# note: 배경/ 후면 패널
정보 = CodeBlock()
# ---------- 정보.designscript (5 lines) ----------
"To keep Dynamo graphs neat and readable, we recommend following a clear
structure.

For more information, read the Dynamo Primer page on best-practice graph strategies:
https://primer2.dynamobim.org/9_best_practices/1-graph-strategies";
# ----------------------------------------
