# Dynamo graph Import & Export Workflow.dyn "가져오기 및 내보내기 워크플로우" (Dynamo 4.0.0.3076)
# author: Dynamo
# 이 문서는 Excel 및 CSV 파일을 가져오고 내보내는 여러가지 방법을 익히는 데 도움이 됩니다.

# group: 그래프 정보
# 메타데이터, 색상 코드 범례, 명명 규칙
# note: DYNAMO 프로젝트
# 가져오기 및 내보내기 워크플로우
# note: DYNAMO VERSION
# 4.2.0
# note: 호스트 응용프로그램 버전
# 해당 없음
# note: 연관된 파일
# 해당 없음
# note: 필수 DYNAMO 패키지
# 해당 없음
# note: 작성자/작성 날짜
# Archilizer for Dynamo Team / 2026년 2월 4일
# note: 추가 해설
# 해당 없음
# note: 설명
# 이 문서는 Excel 및 CSV 파일을 가져오고 내보내는 다양한 방법을 익히는 데 도움이 됩니다.
# 입력 방법은 한 번에 하나만 사용해야 합니다. 사용하지 않는 스크립트는 고정합니다.

# group: 검토
# 결과를 디버그하고 검사합니다. 주 출력에 영향을 미치지 않고 결과를 확인하는 데 사용됩니다.
# note: USE: watch 노드, List.Count, 요약 문자열, "PASS/FAIL" 플래그, 오류 리스트, 미리보기 형상(Watch3D) 및 샘플 출력과 같은 결과를 변경하지 않고 그래프가 예상대로 작동하는지 확인할 수 있도록 사람이 읽을 수 있는 검사입니다.

# group: 주석
# note: USE:
# 주석 및 스크립트 정보용.

# group: 출력
# 그래프에 따라 생성된 최종 결과로, 내보내기 또는 다운스트림에 사용할 준비가 되어 있습니다.
# note: USE: 최종 리스트, 형식이 지정된 문자열, 계산된 값, 사전/테이블 및 내보낼 준비된 데이터와 같이 다운스트림(내보내기 또는 다른 그래프에 연결)에 사용하기 위한 최종 결과

# group: 입력
# 처리가 발생하기 전에 대상 데이터 및 설정을 정의하는 사용자 제어 값
# note: USE: 그래프에서 처리할 항목과 동작 방법을 정의하는 모든 사용자 제어 값입니다.
# 예: 숫자 슬라이더, 문자열, 파일 경로, 부울 토글, 드롭다운 및 초기 리스트.

# group: 작업
# 입력을 처리하는 핵심 작업입니다.
# note: USE: 입력을 결과로 변환하는 기본 처리 파이프라인입니다. 여기서 리스트 정리, 매핑, 필터링, 문자열 논리, 형상 작업, 형식 지정 및 변환과 같은 "작업"이 수행됩니다.

# group: CSV 가져오기/내보내기
# 이 스크립트는 CSV 데이터를 가져와서 정의된 명명 규칙에 따라 분석 및 재구성하고 검토 및 수정을 위해 유효한 항목과 잘못된 항목을 분리합니다. 이 워크플로우에서 이름 리스트는 규칙 기반 유효성 검사 논리를 사용하여 처리되고 명명 규칙에 따라 정렬되며 유효한 그룹과 잘못된 그룹으로 분류됩니다. 유효한 이름은 조정 및 보고와 같은 다운스트림 사용을 위해 내보냅니다.
# note: 팁: 입력 뒤에 watch 노드를 추가하면 파일을 가져오는 방법을 확인할 수 있습니다.

# group: Excel 가져오기/내보내기 > Excel 가져오기
# Excel(.xlsx) 파일에서 Dynamo로 데이터를 가져와 처리, 유효성 검사 및 조작을 수행할 수 있도록 스프레드시트의 행과 열을 구조화된 리스트로 변환할 수 있습니다. 일반적인 용도로는 다운스트림 워크플로우의 일람표, 매개변수 및 수량이 있습니다.
# note: Click Browse and select your own Excel (.xlsx) file before running this graph
file_path = Filename("선택한 파일이 없습니다.")
string = StringInput("sheet1")
# note: 숫자를 읽는 경우에는 false로 설정합니다.
# 문자를 읽는 경우에는 true로 설정합니다.
boolean = BoolSelector(false)
openXMLImportExcel = Data.OpenXMLImportExcel(filePath=file_path, sheetName=string, readAsString=boolean)
# note: List.Transpose를 사용하여 리스트의 열을 읽습니다.
# 리스트의 행을 읽기 위해 행과 열을 바꾸지 마십시오.
transpose = List.Transpose()  # unwired: lists

# group: Excel 가져오기/내보내기 > Excel을 위한 데이터 구조화
# null/빈 항목을 제거하고 헤더를 제거합니다.
# note: 헤더 검색
deconstruct = List.Deconstruct(list=openXMLImportExcel)
부울 = BoolSelector(false)
clean = List.Clean(list=deconstruct.rest, preserveIndices=부울)

# group: Excel 가져오기/내보내기 > 유사성 기준 그룹화
# Excel 데이터 조작의 예
transpose_2 = List.Transpose(lists=clean)
code_block_열_색인 = CodeBlock { 1; }
# note: 단일 키 열을 추출하는 데에만 사용
getItemAtIndex = List.GetItemAtIndex(list=transpose_2, index=code_block_열_색인)
number = DoubleInput(0)
boolean_2 = BoolSelector(false)
groupBySimilarity = List.GroupBySimilarity(list=getItemAtIndex, tolerance=number, considerAdjacency=boolean_2)

# group: Excel 가져오기/내보내기 > 바닥 열 추출
# 열 색인 확인
watch = Watch(getItemAtIndex)

# group: CSV 가져오기/내보내기 > CSV 가져오기
# CSV 데이터를 Dynamo로 가져와 규칙 기반 유효성 검사, 정렬 및 분류 워크플로우에 맞게 구조화합니다.
# note: Click Browse and select your own CSV (.csv) file before running this graph
file_path_2 = Filename("선택한 파일이 없습니다.")
boolean_3 = BoolSelector(true)
# note: 열을 읽으려면 리스트의 행과 열을 바꿉니다.
# 행을 읽으려면 리스트의 행과 열을 바꾸지 마십시오.
importCSV = Data.ImportCSV(filePath=file_path_2, transpose=boolean_3)

# group: CSV 가져오기/내보내기 > CSV를 위한 데이터 구조화
# 데이터 구조화: 다운스트림 규칙이 항상 일관된 문자열 리스트(null 없음, 내포된 리스트 없음, 정리된 형식)를 수신하도록 입력을 병합하고 정리합니다.
deconstruct_2 = List.Deconstruct(list=importCSV)
transpose_3 = List.Transpose(lists=deconstruct_2.rest)
code_block_읽을_열의_색인 = CodeBlock { 0; }
getItemAtIndex_2 = List.GetItemAtIndex(list=transpose_3, index=code_block_읽을_열의_색인)
boolean_4 = BoolSelector(false)
clean_2 = List.Clean(list=getItemAtIndex_2, preserveIndices=boolean_4)

# group: CSV 가져오기/내보내기 > 검토
# 헤더 추출 확인
watch_헤더 = Watch(deconstruct_2.first)

# group: CSV 가져오기/내보내기 > 키워드 정의
# 검사에 사용되는 사무실 명명 규칙을 정의하는 사용자 편집 가능한 설정(대문자, 키워드 및 필수 구분 기호). 프로젝트 또는 사무실 표준에 맞게 업데이트할 수 있습니다.
# note: 사무실 명명 규칙에 맞게 이 리스트 편집
toUpper = String.ToUpper(string=clean_2)
code_block = CodeBlock { "-"; }
code_block_2 = CodeBlock()
# ---------- code_block_2.designscript (2 lines) ----------
// one output list
["GA","DET","STRUCT"];
# ----------------------------------------
code_block_3 = CodeBlock { 0; }
code_block_4 = CodeBlock { 1; }
code_block_5 = CodeBlock { 2; }

# group: CSV 가져오기/내보내기 > 규칙 검사(대문자 + 구분 기호)
# 이름별 부울 규칙 출력을 생성합니다. 각 이름이 대문자인지 여부와 필수 구분 기호 문자열을 포함하는지 여부를 검사합니다.
eq = clean_2 == toUpper
contains = String.Contains(string=clean_2, searchFor=code_block)

# group: CSV 가져오기/내보내기 > 키워드 검사(모든 키워드 포함)
# 각 이름에 승인된 키워드가 하나 이상 포함되어 있는지 검사합니다. 부울 리스트를 출력하는데, 이 리스트의 각 항목은 일치하는 이름에 해당합니다.
getItemAtIndex_3 = List.GetItemAtIndex(list=code_block_2, index=code_block_3)
contains_2 = String.Contains(string=clean_2, searchFor=getItemAtIndex_3)
getItemAtIndex_4 = List.GetItemAtIndex(list=code_block_2, index=code_block_4)
contains_3 = String.Contains(string=clean_2, searchFor=getItemAtIndex_4)
or_ = Or(bool0=contains_2, bool1=contains_3)
getItemAtIndex_5 = List.GetItemAtIndex(list=code_block_2, index=code_block_5)
contains_4 = String.Contains(문자열=clean_2, searchFor=getItemAtIndex_5)
or_2 = Or(bool0=or_, bool1=contains_4)

# group: CSV 가져오기/내보내기 > 검사를 최종 마스크에 결합
# 논리를 사용하여 모든 규칙 출력을 최종 부울 마스크 하나로 결합합니다. 이 마스크는 각 이름이 유효한지 또는 유효하지 않은지 정의합니다.
and_ = And(bool0=eq, bool1=contains)
and_2 = And(bool0=and_, bool1=or_2)

# group: CSV 가져오기/내보내기 > 유효한 이름과 잘못된 이름
# 출력: 최종 마스크에 따라 입력 이름 리스트를 유효한 결과와 잘못된 결과로 분할합니다.
filterByBoolMask = List.FilterByBoolMask(list=clean_2, mask=and_2)

# group: CSV 가져오기/내보내기 > 디버그 및 요약
# 입력, 규칙 및 출력을 확인하기 위한 시각적 검사
유효한_이름 = Watch(filterByBoolMask.in)
유효하지_않은_이름 = Watch(filterByBoolMask.out)

# group: CSV 가져오기/내보내기 > CSV로 내보내기
# Valida 이름 세트를 내보냅니다.
file_path_3 = Filename("선택한 파일이 없습니다.")
exportCSV = Data.ExportCSV(filePath=file_path_3, data=filterByBoolMask.in)

# group: Excel 가져오기/내보내기 > 검토/ 그룹화된 바닥
# 유사성 클러스터링 후 그룹화된 바닥 값의 미리보기. 올바른 그룹화 및 이름 지정 일관성을 확인하는 데 사용됩니다.
watch_2 = Watch(groupBySimilarity.groupedValues)

# group: Excel 가져오기/내보내기 > 검토/ 그룹화된 바닥
# 유사성 클러스터링 후 그룹화된 바닥 값의 미리보기. 올바른 그룹화 및 이름 지정 일관성을 확인하는 데 사용됩니다.
watch_3 = Watch(groupBySimilarity.groupedIndices)

# group: Excel 가져오기/내보내기
# 이 스크립트는 Excel에서 구조화된 데이터를 가져오고 정의된 규칙에 따라 처리 및 재구성하고 외부에서 사용할 수 있도록 변환된 결과를 내보냅니다. 이 워크플로우에서는 룸 리스트를 가져와 위치별로 분석 및 재정렬하여 룸을 공간 기준에 따라 구조적 리스트로 그룹화합니다. 그런 다음 처리된 데이터는 조정 및 보고에 사용할 수 있도록 내보냅니다.
integer_slider = IntegerSlider(1, range=0..2 step 1)

# group: Excel 가져오기/내보내기 > 내보내기 전에 헤더 삽입(선택 사항)
# 내보낸 데이터의 시작 부분에 헤더 행을 삽입합니다.
# note: GroupedIndices를 사용하여 원래 행 가져오기
getItemAtIndex_6 = List.GetItemAtIndex(list=clean, index=groupBySimilarity.groupedIndices)
flatten = List.Flatten(list=getItemAtIndex_6, amount=integer_slider)
integer_slider_2 = IntegerSlider(0, range=0..2 step 1)
# note: 내보내기 전에 인덱스 0에서 헤더 삽입
insert = List.Insert(list=flatten, element=deconstruct.first, index=integer_slider_2)

# group: Excel 가져오기/내보내기 > 검토/그룹화된 행 구조
# 단순화하여 내보내기 전에 내포된 행 구조를 검사합니다.
watch_4 = Watch(insert)

# group: Excel 가져오기/내보내기 > Excel로 내보내기
# 구조화된 Dynamo 데이터를 Excel(.xlsx)로 내보냅니다. 외부 검토 및 다른 도구와의 통합을 위한 출력을 지원합니다.
# note: 내보내기 파일 이름은 .xlsx로 끝나야 합니다.
# 이름이 같은 파일이 이미 있고 덮어쓰기가 false로 설정된 경우 내보내기에 실패하고 새 파일이 작성되지 않습니다.
# 기존 파일을 대체하려면 덮어쓰기를 사용하도록 설정해야 합니다.
파일_경로 = Filename("선택한 파일이 없습니다.")
string_2 = StringInput("\"시트 내보내기\"")
integer_slider_3 = IntegerSlider(0, range=0..100 step 1)
부울_2 = BoolSelector(true)
openXMLExportExcel = Data.OpenXMLExportExcel(filePath=파일_경로, sheetName=string_2, data=insert, startRow=integer_slider_3, startColumn=integer_slider_3, writeAsString=부울_2)

# group: 형상 가져오기/내보내기 > 형상 가져오기
# SAT 파일에서 Dynamo로 형상을 가져와 변환 워크플로우에 사용할 수 있는 편집 가능한 곡선, 표면 및 솔리드로 변환합니다.
# note: Click Browse and select your own SAT (.sat) file before running this graph
file_path_4 = Filename("선택한 파일이 없습니다.")
경로의_파일 = FileObject(path=file_path_4)
단위 = Units("Meters")
# note: 파일을 Dynamo 솔리드/표면/곡선으로 가져오기
importFromSATWithUnits = Geometry.ImportFromSATWithUnits(file_filePath=경로의_파일, dynamoUnit=단위)
watch_3d_가져온_형상_미리보기 = Watch3D(importFromSATWithUnits)

# group: 형상 가져오기/내보내기 > 디버그/학습 그룹
# Dynamo가 각 항목을 어떻게 인식하는지을 표시합니다(솔리드, 곡면, 곡선 등).
# 가져오기가 예기치 않게 동작하는 경우에 유용합니다.
type = Object.Type(object=importFromSATWithUnits)
watch_5 = Watch(type)

# group: 형상 가져오기/내보내기 > 변환
# 가져온 형상의 축척을 균일한 비율로 조정합니다.
XY = Plane.XY()
code_block_6 = CodeBlock { 5; }
scale = Geometry.Scale(geometry=importFromSATWithUnits, plane=XY, xamount=code_block_6, yamount=code_block_6, zamount=code_block_6)

# group: 형상 가져오기/내보내기 > SAT로 내보내기
# 업데이트된 형상을 SAT 파일로 내보냅니다. SAT 파일은 AutoCAD, Revit 등으로 가져올 수 있습니다.
file_path_5 = Filename("선택한 파일이 없습니다.")
exportToSAT = Geometry.ExportToSAT(geometry=scale, filePath=file_path_5)
watch_3d_축척_조정된_형상_미리보기 = Watch3D(scale)
