# Dynamo graph Make a Custom Node.dyn "사용자 노드 만들기" (Dynamo 3.0.3.7597)
# author: Dynamo
# 이 문서는 사용자 노드 작성을 익히는 데 도움이 됩니다.

# group: 그래프 정보
# 메타데이터, 색상 코드 범례, 명명 규칙
# note: DYNAMO 프로젝트
# 사용자 노드 만들기
# note: DYNAMO 버전
# 4.1.0
# note: 호스트 응용프로그램 버전
# 해당 없음
# note: ASSOCIATED FILE(S)
# Curve_Validate.dyf
# note: 필수 DYNAMO 패키지
# 해당 없음
# note: 작성자/작성 날짜
# Archilizer for Dynamo Team / 2026년 2월 4일
# note: ADDITIONAL COMMENTS
# Custom nodes are typically found in the Add-ons section of the Library.
# This custom node is located under:
# Add-ons → Templates → Curve → Curve_Validate
# If it does not appear:
# Check that the .dyf file is in your custom nodes folder
# Go to:
# Packages → Package Manager → Package Settings → Package/Library Search Paths
# Verify the folder path is listed or add a new path
# Restart Dynamo after adding new custom nodes
# note: 설명
# 이 문서는 사용자 노드 작성 방법을 익히는 데 도움이 됩니다.
# Dynamo 스크립트를 깔끔하고 읽기 쉽게 유지하려면 그래프를 작성할 때
# 깔끔한 구조를 따르는 것이 좋습니다.
# 사용자 노드 작성에 대한 자세한 내용은 Dynamo Primer 페이지를 참조하십시오.
# https://primer2.dynamobim.org/ko/6_custom_nodes_and_packages/6-1_custom-nodes/2-creating

# group: 사용자 노드 내부
# note: 이 스크립트는 간단한 규칙을 사용하여 곡선 형상을 검사하고 필터링합니다. 선, 호 등의 입력 곡선을 가져와 각 객체가 존재하는지, 유효한 곡선인지, 선택적 열림 또는 닫힘 조건을 충족하는지, 선택한 최소 길이보다 긴지 확인합니다. 그러면 노드에서 유효한 곡선, 잘못된 곡선 및 검사를 통과하거나 통과하지 못한 곡선을 보여주는 부울 유효성 검사 마스크를 출력하므로 형상 정리, 이후 단계에서 오류 방지, Dynamo에서 추가 처리를 위한 데이터 준비가 더 쉬워집니다.

# group: 검토
# 결과를 디버그하고 검사합니다. 주 출력에 영향을 미치지 않고 결과를 확인하는 데 사용됩니다.
# note: USE: watch 노드, List.Count, 요약 문자열, "PASS/FAIL" 플래그, 오류 리스트, 미리보기 형상(Watch3D) 및 샘플 출력과 같은 결과를 변경하지 않고 그래프가 예상대로 작동하는지 확인할 수 있도록 사람이 읽을 수 있는 검사입니다.

# group: 주석
# note: USE:
# 주석 및 스크립트 정보용.

# group: 출력
# 그래프에 따라 생성된 최종 결과로, 내보내기 또는 다운스트림에 사용할 준비가 되어 있습니다.
# note: USE: 최종 리스트, 형식이 지정된 문자열, 계산된 값, 사전/테이블 및 내보낼 준비된 데이터와 같이 다운스트림(내보내기 또는 다른 그래프에 연결)에 사용하기 위한 최종 결과

# group: 입력
# 처리가 발생하기 전에 대상 데이터 및 설정을 정의하는 사용자 제어 값
# note: USE: 그래프에서 처리할 항목과 동작 방법을 정의하는 모든 사용자 제어 값입니다.
# 예: 숫자 슬라이더, 문자열, 파일 경로, 부울 토글, 드롭다운 및 초기 리스트.

# group: 작업
# 입력을 처리하는 핵심 작업입니다.
# note: USE: 입력을 결과로 변환하는 기본 처리 파이프라인입니다. 여기서 리스트 정리, 매핑, 필터링, 문자열 논리, 형상 작업, 형식 지정 및 변환과 같은 "작업"이 수행됩니다.

# group: 사용자 노드 내부 > 입력
# 이러한 컨트롤을 사용하여 "유효한"의 의미를 정의합니다.
# 곡선은 선, 호, PolyCurve 또는 혼합 곡선 유형의 리스트일 수 있습니다.
# flattenDepth를 사용하여 중첩된 리스트가 처리되는 방식을 제어합니다.
number = DoubleInput(5)
number_2 = DoubleInput(10)
number_3 = DoubleInput(15)
byCoordinates = Point.ByCoordinates(x=number, y=number_2, z=number_3)
byCoordinates_2 = Point.ByCoordinates(x=number_3, y=number, z=number_2)
byCoordinates_3 = Point.ByCoordinates(x=number_2, y=number_3, z=number)
리스트_작성 = List.Create(item0=byCoordinates, item1=byCoordinates_2, item2=byCoordinates_3)
byPoints = NurbsCurve.ByPoints(points=리스트_작성)
number_4 = DoubleInput(1)

# group: 사용자 노드 내부 > Null 및 유형 유효성 검사
# 곡선 형상 검사를 실행하기 전에 null과 곡선 이외 객체를 필터링합니다.
# 따라서 경고가 방지되고 입력 유형이 혼합된 경우에도 노드가 더 안전해집니다.
flatten = List.Flatten(list=byPoints, amount=number_4)
type = Object.Type(object=flatten)
isNull = Object.IsNull(object=flatten)
not_ = Not(x=isNull)

# group: 사용자 노드 내부 > 고려할 형상 유형
# 형상과 같은 곡선
string = StringInput("선")
boolean = BoolSelector(true)
contains = String.Contains(문자열=type, searchFor=string, ignoreCase=boolean)
string_2 = StringInput("곡선")
contains_2 = String.Contains(문자열=type, searchFor=string_2, ignoreCase=boolean)
문자열 = StringInput("호")
contains_3 = String.Contains(문자열=type, searchFor=문자열, ignoreCase=boolean)
string_3 = StringInput("PolyCurve")
contains_4 = String.Contains(string=type, searchFor=string_3, ignoreCase=boolean)
or_ = Or(bool0=contains, bool1=contains_2, bool2=contains_3, bool3=contains_4)

# group (continued): 사용자 노드 내부 > Null 및 유형 유효성 검사
and_ = And(bool0=or_, bool1=not_)
filterByBoolMask = List.FilterByBoolMask(list=flatten, mask=and_)

# group: 사용자 노드 내부 > 입력
# 이러한 컨트롤을 사용하여 "유효한"의 의미를 정의합니다.
# minLength는 최소 원곡선 길이 임계값입니다.
# 곡선을 닫아야 하는 경우(루프) requireClosed를 true로 설정합니다.
number_5 = DoubleInput(5)
boolean_2 = BoolSelector(false)

# group: 사용자 노드 내부 > 형상 검사(길이 및 마무리)
# 곡선 규칙을 적용합니다.
# 길이는 minLength보다 크거나 같아야 합니다.
# requireClosed가 true이면 곡선이 닫혀야 합니다.
length = Curve.Length(curve=filterByBoolMask.in)
# note: MinLength보다 짧은 곡선은 유효하지 않습니다.
ge = length >= number_5
isClosed = Curve.IsClosed(curve=filterByBoolMask.in)
boolean_3 = BoolSelector(true)
if_ = RefactoredIf(test=boolean_2, true=isClosed, false=boolean_3)
and_2 = And(bool0=ge, bool1=if_)

# group: 사용자 노드 내부 > 유효한 곡선과 유효하지 않은 곡선 분할
# 마지막 부울 마스크를 사용하여 곡선을 유효한 리스트와 유효하지 않은 리스트로 분리합니다.
filterByBoolMask_2 = List.FilterByBoolMask(list=filterByBoolMask.in, mask=and_2)

# group: 사용자 노드 내부 > 출력
# validCurves: 유효성 검사를 통과한 곡선
# invalidCurves: 유효성 검사를 통과하지 못한 곡선
# maskValid: 다른 곳에서 필터링하기 위한 부울 마스크
code_block = CodeBlock(maskValid=and_2)
# ---------- code_block.designscript (4 lines) ----------
// Boolean mask of validation results
 // true  = valid curve
 // false = invalid curve
 maskValid : bool[]..[];
# ----------------------------------------
code_block_2 = CodeBlock(invalidCurves=filterByBoolMask_2.out)
# ---------- code_block_2.designscript (3 lines) ----------
// Curves that failed validation
 // These should not be used for modelling
 invalidCurves : var[]..[];
# ----------------------------------------
code_block_3 = CodeBlock(validCurves=filterByBoolMask_2.in)
# ---------- code_block_3.designscript (3 lines) ----------
// Curves that passed all validation checks
 // These are safe to use for modelling and automation
 validCurves : var[]..[];
# ----------------------------------------

# group: 입력
# 이러한 컨트롤을 사용하여 "유효한"의 의미를 정의합니다.
# 곡선은 선, 호, PolyCurve 또는 혼합 곡선 유형의 리스트일 수 있습니다.
# flattenDepth를 사용하여 내포된 리스트가 처리되는 방법을 제어합니다
number_6 = DoubleInput(5)
boolean_4 = BoolSelector(false)
number_7 = DoubleInput(5)
number_8 = DoubleInput(10)
number_9 = DoubleInput(15)
byCoordinates_4 = Point.ByCoordinates(x=number_7, y=number_8, z=number_9)
byCoordinates_5 = Point.ByCoordinates(x=number_9, y=number_7, z=number_8)
byCoordinates_6 = Point.ByCoordinates(x=number_8, y=number_9, z=number_7)
리스트_작성_2 = List.Create(item0=byCoordinates_4, item1=byCoordinates_5, Item2=byCoordinates_6)
byPoints_2 = NurbsCurve.ByPoints(points=리스트_작성_2)
number_10 = DoubleInput(1)

# group: 사용자 노드
# 노드를 두 번 클릭하여 확장하고 dyf 파일을 엽니다.
# note: 이 논리는 사용자 노드 하나로 압축되어 여러 Dynamo 그래프 간에 간단하고 재사용 가능하며 일관된 방식으로 곡선을 검사할 수 있습니다. 매번 동일한 검증 단계를 다시 작성하는 대신 쉽게 재사용 및 업데이트하고 공유할 수 있는 깔끔한 도구 하나에 규칙이 포함됩니다. 따라서 오류가 줄어들고 그래프를 깔끔하고 읽기 쉽게 유지할 수 있습니다
curve_Validate = Custom[Curve_Validate](minLength=number_6, requireClosed=boolean_4, curveLikeGeometry=byPoints_2, flattenDepth=number_10)  # Null, 유형, 길이 공차 및 선택적 마무리를 검사하여 곡선 형상의 유효성을 검사합니다. 유효한/유효하지 않은 곡선, 부울 마스크 및 실패 이유를 반환합니다.

# group: 출력
# 유효한 곡선, 잘못된 곡선 및 유효성 검사 마스크를 표시합니다.
watch = Watch(curve_Validate.invalidCurves)
watch_2 = Watch(curve_Validate.validCurves)
watch_3 = Watch(curve_Validate.maskValid)
