# Dynamo graph Create a Graph.dyn "Tworzenie wykresu" (Dynamo 4.0.0.3076)
# author: Dynamo
# Ten dokument pomaga zapoznać się ze standardowym procesem roboczym i następującymi ważnymi krokami.

# group: TWORZENIE WYKRESU DODATKU DYNAMO > Przykład
# note: Generator nazw

# group: Standardy nazewnictwa grup Dane wejściowe → Działanie → Dane wyjściowe → Przegląd > Dane wejściowe
# WARTOŚCI KONTROLOWANE PRZEZ UŻYTKOWNIKA, KTÓRE DEFINIUJĄ DANE DOCELOWE I USTAWIENIA PRZED ROZPOCZĘCIEM PRZETWARZANIA
# note: ZASTOSOWANIE: wszystkie wartości kontrolowane przez użytkownika, które definiują, co wykres będzie przetwarzał i jak powinien się zachowywać.
# Obejmuje to na przykład suwaki liczb, ciągi, ścieżki plików, przełączniki logiczne, listy rozwijane i listy początkowe.

# group: Standardy nazewnictwa grup Dane wejściowe → Działanie → Dane wyjściowe → Przegląd > Działania
# OPERACJE PODSTAWOWE, KTÓRE PRZETWARZAJĄ DANE WEJŚCIOWE
# note: ZASTOSOWANIE: główny proces organizacji produkcji, który przekształca dane wejściowe w wyniki. W tym miejscu odbywa się rzeczywista praca, taka jak czyszczenie list, odwzorowywanie, filtrowanie, obliczanie logiki ciągów, wykonywanie operacji na geometrii, formatowanie, konwersja.

# group: Standardy nazewnictwa grup Dane wejściowe → Działanie → Dane wyjściowe → Przegląd > Dane wyjściowe
# KOŃCOWE WYNIKI WYTWARZANE PRZEZ WYKRES, GOTOWE DO EKSPORTU LUB PÓŹNIEJSZEGO UŻYCIA
# note: ZASTOSOWANIE: wyniki końcowe przeznaczone do dalszego użycia (eksportowania, podłączenia do innego wykresu), takie jak listy końcowe, sformatowane ciągi, obliczone wartości, słowniki/tabele, dane gotowe do wyeksportowania

# group: Standardy nazewnictwa grup Dane wejściowe → Działanie → Dane wyjściowe → Przegląd > Przegląd
# DEBUGOWANIE I SPRAWDZANIE DANYCH WEJŚCIOWYCH; WERYFIKACJA WYNIKÓW BEZ WPŁYWANIA NA GŁÓWNE DANE WYJŚCIOWE
# note: ZASTOSOWANIE: kontrole czytelne dla człowieka, dzięki którym można sprawdzić, czy wykres działa zgodnie z oczekiwaniami, bez zmieniania wyników. Obejmuje to między innymi węzły obserwacyjne, węzeł List.Count, ciągi podsumowania, flagi „PASS/FAIL”, listy błędów, geometrię podglądu (Watch3D) i przykładowe dane wyjściowe.

# group: Standardy nazewnictwa grup Dane wejściowe → Działanie → Dane wyjściowe → Przegląd > Opisy
# note: ZASTOSOWANIE:
# UZYSKIWANIE KOMENTARZY I INFORMACJI O SKRYPTACH

# group: Informacje o wykresie
# Metadane, legenda znaczenia kolorów, reguły nazewnictwa
# note: PROJEKT DODATKU DYNAMO
# Utwórz wykres
# note: WERSJA DODATKU DYNAMO
# 4.2.0
# note: WERSJA APLIKACJI HOSTA
# Brak
# note: SKOJARZONE PLIKI
# Brak
# note: WYMAGANE PAKIETY DODATKU DYNAMO
# Brak
# note: AUTORZY / DATA UTWORZENIA
# Archilizer for Dynamo Team / 4 lutego 2026 r.
# note: UWAGI DODATKOWE
# Brak
# note: OPIS
# Ten dokument pomaga zapoznać się ze standardowym procesem roboczym i następującymi ważnymi krokami.

# group: TWORZENIE WYKRESU DODATKU DYNAMO > Informacje o wykresie
# Metadane, legenda znaczenia kolorów, reguły nazewnictwa
# note: PROJEKT DODATKU DYNAMO
# Zobacz „Standardy nazewnictwa plików wykresów”.
# note: WERSJA DODATKU DYNAMO
# note: WERSJA APLIKACJI HOSTA
# note: SKOJARZONE PLIKI
# note: WYMAGANE PAKIETY DODATKU DYNAMO
# note: AUTORZY / DATA UTWORZENIA
# note: UWAGI DODATKOWE
# note: OPIS
# Opis wykresu powinien zawierać informacje o tym,
# do czego służy wykres, jakich danych używa,
# jakie reguły stosuje, co wyprowadza,
# gdzie i jak działa (aplikacja hosta + wersja), a także wyjaśniać ważne ograniczenia.

# group: TWORZENIE WYKRESU DODATKU DYNAMO > Odtwarzacz Dynamo Dane wejściowe → Działania → Dane wyjściowe
# Odtwarzacz Dynamo umożliwia uruchamianie wykresów dodatku Dynamo bez otwierania interfejsu tego dodatku.
# Użytkownicy uruchamiają skrypty, korzystając tylko ze wstępnie zdefiniowanych danych wejściowych.
# note: Kliknij prawym przyciskiem myszy węzeł wejściowy i wybierz opcję „To dane wejściowe”.
dane_wejściowe = StringInput("Odtwarzacz Dynamo")  # graph input
twoje_działanie = String.ToUpper(string=dane_wejściowe)
# note: Kliknij prawym przyciskiem myszy węzeł wejściowy i wybierz opcję „To dane wyjściowe”.
uzyskiwane_dane_wyjściowe = Watch(twoje_działanie)  # graph output

# group: TWORZENIE WYKRESU DODATKU DYNAMO > Standardy nazewnictwa węzłów
# note: Nie należy zmieniać całej nazwy węzła. Zamiast tego należy użyć nawiasów na końcu.
string = StringInput("")
# note: ZALECANE
string_dane_wejściowe_1 = StringInput("")
# note: NIEZALECANE
# note: Zaktualizuj te reguły zgodnie ze standardami obowiązującymi w biurze.
dane_wejściowe_1 = StringInput("")
typowe_reguły_zalecanych = CodeBlock()  # "Typowe reguły zalecanych/niezalecanych działań"
# ---------- typowe_reguły_zalecanych.designscript (12 lines) ----------
/*
Do:
Rename key nodes only (inputs, rules, outputs, decision logic)
Use notes to add context to your script
Use capitalization consistently (e.g. Title Case or camelCase, not mixed)
*/

/*Do Not:
Rename every node in the graph
Leave important nodes with default names if they affect logic
Use vague names like "Data", "Stuff", "Fix", "Test"
*/;
# ----------------------------------------

# group: TWORZENIE WYKRESU DODATKU DYNAMO > Standardy nazewnictwa plików wykresów
# Aby ułatwić zrozumienie przeznaczenia lub zamierzonego użycia wykresu na podstawie jego nazwy, zalecamy stosowanie wzorca nazewnictwa podobnego do konwencji planu realizacji projektu BIM:
string_2 = StringInput("-")
organizacja = CodeBlock { "AUT"; }
pola_funkcji = CodeBlock { BLD  = "BLD"; STR  = "STR"; MEP  = "MEP"; INFR = "INFR"; }
opis = CodeBlock { "Logical_description"; }
wersja_dodatku_dynamo = CodeBlock { "D303"; }
wersja_skryptu_tylko_w_przypadku = CodeBlock { "V2"; }  # "Wersja skryptu (tylko w przypadku plików kopii zapasowej)"
kolejność_zespołów = String.Join(separator=string_2, ciąg0=organizacja, ciąg1=pola_funkcji.BLD, ciąg2=opis, ciąg3=wersja_dodatku_dynamo, ciąg4=wersja_skryptu_tylko_w_przypadku)
przykład_nazwy = Watch(kolejność_zespołów)
# note: Zalecana struktura nazewnictwa
struktura_nazewnictwa = CodeBlock()
# ---------- struktura_nazewnictwa.designscript (3 lines) ----------
["Organisation  | Function fields | Description         | Dynamo-Version | Script-Version",
"AUT            |BLD              | Logical_description | D303           | V3"
];
# ----------------------------------------
# note: NIE EDYTUJ:
# note: Pola funkcji opisują główny obszar roboczy lub główną dziedzinę skryptu.
pola_funkcji_2 = CodeBlock()
# ---------- pola_funkcji_2.designscript (4 lines) ----------
BLD  = "BLD  — Building design";
STR  = "STR  — Structural design";
MEP  = "MEP  — Mechanical / Electrical / Plumbing";
INFR = "INFR — Infrastructure";
# ----------------------------------------

# group: TWORZENIE WYKRESU DODATKU DYNAMO
# Wizualny przewodnik po strukturze, nazewnictwie i najlepszych praktykach
# note: Używaj węzłów obserwacyjnych tylko w kluczowych punktach kontrolnych.
# Zawieś nieaktywny skrypt.
# note: Przed uruchomieniem wykresu:
# Sprawdź, czy dane wejściowe są ustawione.
# Przejrzyj podgląd/kontrole.
# Uruchom raz ręcznie przed użyciem Odtwarzacza Dynamo.
# Zapisz plik po pomyślnym uruchomieniu.
# note: Ten dokument pomaga zapoznać się ze standardowym procesem roboczym i następującymi ważnymi krokami.
# note: Tło / panel tylny
informacje = CodeBlock()
# ---------- informacje.designscript (5 lines) ----------
"To keep Dynamo graphs neat and readable, we recommend following a clear
structure.

For more information, read the Dynamo Primer page on best-practice graph strategies:
https://primer2.dynamobim.org/9_best_practices/1-graph-strategies";
# ----------------------------------------
