# Dynamo graph Make a Custom Node.dyn "Tworzenie węzła niestandardowego" (Dynamo 3.0.3.7597)
# author: Dynamo
# Ten dokument pomaga zapoznać się z tworzeniem węzła niestandardowego.

# group: Informacje o wykresie
# Metadane, legenda znaczenia kolorów, reguły nazewnictwa
# note: PROJEKT DODATKU DYNAMO
# Tworzenie węzła niestandardowego
# note: WERSJA DODATKU DYNAMO
# 4.1.0
# note: WERSJA APLIKACJI HOSTA
# Brak
# note: POWIĄZANE PLIKI
# Curve_Validate.dyf
# note: WYMAGANE PAKIETY DODATKU DYNAMO
# Brak
# note: AUTORZY / DATA UTWORZENIA
# Archilizer for Dynamo Team / 4 lutego 2026 r.
# note: DODATKOWE KOMENTARZE
# Węzły niestandardowe znajdują się zazwyczaj w sekcji Dodatki w bibliotece.
# Ten węzeł niestandardowy znajduje się w kategorii:
# Dodatki → Szablony → Krzywa → Curve_Validate
# Jeśli go tam nie ma:
# Sprawdź, czy plik DYF znajduje się w folderze węzłów niestandardowych.
# Przejdź do:
# Pakiety → Menedżer pakietów → Ustawienia pakietów → Ścieżki wyszukiwania pakietów/biblioteki
# Sprawdź, czy ścieżka folderu znajduje się na liście, lub dodaj nową ścieżkę.
# Po dodaniu nowych węzłów niestandardowych uruchom ponownie dodatek Dynamo.
# note: OPIS
# Ten dokument pomaga zapoznać się z tworzeniem węzła niestandardowego.
# Aby zachować porządek i czytelność skryptów w dodatku Dynamo, zalecamy przestrzeganie przejrzystej
# struktury podczas tworzenia wykresów.
# Więcej informacji na temat tworzenia węzłów niestandardowych można znaleźć na stronie przewodnika Dynamo Primer:
# https://primer2.dynamobim.org/pl/6_custom_nodes_and_packages/6-1_custom-nodes/2-creating

# group: W WĘŹLE NIESTANDARDOWYM
# note: Ten skrypt sprawdza i filtruje geometrię krzywych za pomocą prostych reguł. Pobiera krzywe wejściowe, takie jak linie i łuki, a następnie weryfikuje, czy każdy obiekt istnieje, jest prawidłową krzywą, spełnia opcjonalny warunek otwarcia/zamknięcia i jest dłuższy niż wybrana długość minimalna. Następnie węzeł zwraca prawidłowe krzywe, nieprawidłowe krzywe i maskę logiczną weryfikacji wskazującą, które krzywe przeszły testy lub ich nie przeszły. Ułatwia to czyszczenie geometrii, unikanie błędów w późniejszych krokach i przygotowywanie danych do dalszego przetwarzania w dodatku Dynamo.

# group: Przegląd
# DEBUGOWANIE I SPRAWDZANIE DANYCH WEJŚCIOWYCH; WERYFIKACJA WYNIKÓW BEZ WPŁYWANIA NA GŁÓWNE DANE WYJŚCIOWE
# note: ZASTOSOWANIE: kontrole czytelne dla człowieka, dzięki którym można sprawdzić, czy wykres działa zgodnie z oczekiwaniami, bez zmieniania wyników. Obejmuje to między innymi węzły obserwacyjne, węzeł List.Count, ciągi podsumowania, flagi „PASS/FAIL”, listy błędów, geometrię podglądu (Watch3D) i przykładowe dane wyjściowe.

# group: Opisy
# note: ZASTOSOWANIE:
# POZWALA UZYSKAĆ KOMENTARZE I INFORMACJE O SKRYPCIE.

# group: Dane wyjściowe
# KOŃCOWE WYNIKI WYTWARZANE PRZEZ WYKRES, GOTOWE DO EKSPORTU LUB PÓŹNIEJSZEGO UŻYCIA
# note: ZASTOSOWANIE: wyniki końcowe przeznaczone do dalszego użycia (eksportowania, podłączenia do innego wykresu), takie jak listy końcowe, sformatowane ciągi, obliczone wartości, słowniki/tabele, dane gotowe do wyeksportowania

# group: Dane wejściowe
# WARTOŚCI KONTROLOWANE PRZEZ UŻYTKOWNIKA, KTÓRE DEFINIUJĄ DANE DOCELOWE I USTAWIENIA PRZED ROZPOCZĘCIEM PRZETWARZANIA
# note: ZASTOSOWANIE: wszystkie wartości kontrolowane przez użytkownika, które definiują, co wykres będzie przetwarzał i jak powinien się zachowywać.
# Obejmuje to na przykład suwaki liczb, ciągi, ścieżki plików, przełączniki logiczne, listy rozwijane i listy początkowe.

# group: Działania
# OPERACJE PODSTAWOWE, KTÓRE PRZETWARZAJĄ DANE WEJŚCIOWE
# note: ZASTOSOWANIE: główny proces organizacji produkcji, który przekształca dane wejściowe w wyniki. W tym miejscu odbywa się rzeczywista praca, taka jak czyszczenie list, odwzorowywanie, filtrowanie, obliczanie logiki ciągów, wykonywanie operacji na geometrii, formatowanie, konwersja.

# group: W WĘŹLE NIESTANDARDOWYM > Dane wejściowe
# Te opcje pozwalają zdefiniować, co jest prawidłowe.
# Krzywe mogą być listami linii, łuków, polikrzywych lub krzywych mieszanych.
# Używając polecenia flattenDepth, można sterować sposobem obsługi list zagnieżdżonych.
liczba = DoubleInput(5)
liczba_2 = DoubleInput(10)
liczba_3 = DoubleInput(15)
byCoordinates = Point.ByCoordinates(x=liczba, y=liczba_2, z=liczba_3)
byCoordinates_2 = Point.ByCoordinates(x=liczba_3, y=liczba, z=liczba_2)
byCoordinates_3 = Point.ByCoordinates(x=liczba_2, y=liczba_3, z=liczba)
tworzenie_listy = List.Create(item0=byCoordinates, item1=byCoordinates_2, item2=byCoordinates_3)
byPoints = NurbsCurve.ByPoints(points=tworzenie_listy)
liczba_4 = DoubleInput(1)

# group: W WĘŹLE NIESTANDARDOWYM > Weryfikacja wartości null i typów
# Filtruje wartości null i obiekty niebędące krzywymi przed uruchomieniem kontroli geometrii krzywych.
# Zapobiega to wyświetlaniu ostrzeżeń i sprawia, że węzeł jest bezpieczniejszy w przypadku mieszanych danych wejściowych.
flatten = List.Flatten(list=byPoints, amount=liczba_4)
type = Object.Type(obiect=flatten)
isNull = Object.IsNull(obiect=flatten)
nie = Not(x=isNull)

# group: W WĘŹLE NIESTANDARDOWYM > Typ geometrii do rozważenia
# Geometria podobna do krzywej
string = StringInput("Line")
boolean = BoolSelector(true)
contains = String.Contains(string=type, searchFor=string, ignoreCase=boolean)
string_2 = StringInput("Curve")
contains_2 = String.Contains(string=type, searchFor=string_2, ignoreCase=boolean)
string_3 = StringInput("Arc")
contains_3 = String.Contains(string=type, searchFor=string_3, ignoreCase=boolean)
string_4 = StringInput("PolyCurve")
contains_4 = String.Contains(string=type, searchFor=string_4, ignoreCase=boolean)
lub = Or(bool0=contains, bool1=contains_2, bool2_powiedział=contains_3, bool3_powiedział=contains_4)

# group (continued): W WĘŹLE NIESTANDARDOWYM > Weryfikacja wartości null i typów
I = And(bool0=lub, bool1=nie)
filterByBoolMask = List.FilterByBoolMask(list=flatten, mask=I)

# group: W WĘŹLE NIESTANDARDOWYM > Dane wejściowe
# Te opcje pozwalają zdefiniować, co jest prawidłowe.
# Wartość minLength jest wartością progową minimalnej długości łuku.
# Jeśli krzywe muszą być zamknięte (być pętlami), ustaw parametr requireClosed na wartość true.
liczba_5 = DoubleInput(5)
boolean_2 = BoolSelector(false)

# group: W WĘŹLE NIESTANDARDOWYM > Kontrole geometrii (długość i zamknięcie)
# Stosuje reguły krzywych:
# Długość musi wynosić co najmniej minLength.
# Jeśli parametr requireClosed ma wartość true, krzywa musi być zamknięta.
length = Curve.Length(krzywa=filterByBoolMask.in)
# note: Krzywe krótsze niż MinLength są nieprawidłowe.
ge = length >= liczba_5
isClosed = Curve.IsClosed(curve=filterByBoolMask.in)
boolean_3 = BoolSelector(true)
if_ = RefactoredIf(test=boolean_2, true=isClosed, false=boolean_3)
oraz = And(bool0=ge, bool1=if_)

# group: W WĘŹLE NIESTANDARDOWYM > Dzielenie krzywych prawidłowych i nieprawidłowych
# Używa końcowej maski logicznej do rozdzielenia krzywych na listy prawidłowych i nieprawidłowych.
filterByBoolMask_2 = List.FilterByBoolMask(list=filterByBoolMask.in, mask=oraz)

# group: W WĘŹLE NIESTANDARDOWYM > Dane wyjściowe
# validCurves: krzywe, które przeszły weryfikację
# invalidCurves: krzywe, które nie przeszły weryfikacji
# maskValid: maska logiczna do filtrowania w innych miejscach
blok_kodu = CodeBlock(maskValid=oraz)
# ---------- blok_kodu.designscript (4 lines) ----------
// Boolean mask of validation results
 // true  = valid curve
 // false = invalid curve
 maskValid : bool[]..[];
# ----------------------------------------
blok_kodu_2 = CodeBlock(invalidCurves=filterByBoolMask_2.out)
# ---------- blok_kodu_2.designscript (3 lines) ----------
// Curves that failed validation
 // These should not be used for modelling
 invalidCurves : var[]..[];
# ----------------------------------------
blok_kodu_3 = CodeBlock(validCurves_validCurves=filterByBoolMask_2.in)
# ---------- blok_kodu_3.designscript (3 lines) ----------
// Curves that passed all validation checks
 // These are safe to use for modelling and automation
 validCurves : var[]..[];
# ----------------------------------------

# group: Dane wejściowe
# Te opcje pozwalają zdefiniować, co jest prawidłowe.
# Krzywe mogą być listami linii, łuków, polikrzywych lub krzywych mieszanych.
# Używając polecenia flattenDepth, można sterować sposobem obsługi list zagnieżdżonych.
liczba_6 = DoubleInput(5)
boolean_4 = BoolSelector(false)
liczba_7 = DoubleInput(5)
liczba_8 = DoubleInput(10)
liczba_9 = DoubleInput(15)
byCoordinates_4 = Point.ByCoordinates(x=liczba_7, y=liczba_8, z=liczba_9)
byCoordinates_5 = Point.ByCoordinates(x=liczba_9, y=liczba_7, z=liczba_8)
byCoordinates_6 = Point.ByCoordinates(x=liczba_8, y=liczba_9, z=liczba_7)
tworzenie_listy_2 = List.Create(pozycja0=byCoordinates_4, item1=byCoordinates_5, item2=byCoordinates_6)
byPoints_2 = NurbsCurve.ByPoints(points=tworzenie_listy_2)
liczba_10 = DoubleInput(1)

# group: WĘZEŁ NIESTANDARDOWY
# Kliknij dwukrotnie węzeł, aby go rozwinąć i otworzyć plik DYF.
# note: Ta logika jest skompresowana jako węzeł niestandardowy, aby sprawdzanie krzywych było prostą funkcją wielokrotnego użytku, która działa spójnie na różnych wykresach dodatku Dynamo. Zamiast za każdym razem powtarzać te same kroki weryfikacji, wystarczy użyć reguł zawartych w jednym przejrzystym narzędziu, które może być wielokrotnie używane, aktualizowane i łatwo udostępniane. Zmniejsza to liczbę błędów oraz sprawia, że wykresy są przejrzyste i czytelne.
curve_Validate = Custom[Curve_Validate](Minlength=liczba_6, requireClosed=boolean_4, curveLikeGeometry=byPoints_2, flattenDepth=liczba_10)  # Weryfikuje geometrię krzywej przez sprawdzenie wartości zerowych, typu, tolerancji długości i opcjonalnego zamknięcia. Zwraca prawidłowe/nieprawidłowe krzywe, maskę logiczną i przyczyny niepowodzenia.

# group: Dane wyjściowe
# Pokazuje prawidłowe krzywe, nieprawidłowe krzywe i maskę weryfikacji.
obserwacja = Watch(curve_Validate.invalidCurves)
obserwacja_2 = Watch(curve_Validate.validCurves)
obserwacja_3 = Watch(curve_Validate.maskValid)
