# Dynamo graph Create a Graph.dyn "Criar um gráfico" (Dynamo 4.0.0.3076)
# author: Dynamo
# Este documento ajudará você a se familiarizar com um fluxo de trabalho padronizado e as seguintes etapas importantes.

# group: COMO CRIAR UM GRÁFICO DO DYNAMO > Exemplo
# note: Gerador de nomes

# group: Normas de nomenclatura de grupo Entradas → Ação → Saídas → Revisão > Entradas
# VALORES CONTROLADOS PELO USUÁRIO QUE DEFINEM OS DADOS E AS CONFIGURAÇÕES DE DESTINO ANTES DE QUALQUER PROCESSAMENTO OCORRER
# note: USAR: todos os valores controlados pelo usuário que definem o que o gráfico processará e como ele deve se comportar.
# Exemplos, controles deslizantes de número, sequências de caracteres, caminhos do arquivo, alternâncias booleanas, menus suspensos, listas iniciais.

# group: Normas de nomenclatura de grupo Entradas → Ação → Saídas → Revisão > Ações
# OPERAÇÕES PRINCIPAIS QUE PROCESSAM AS ENTRADAS
# note: USAR: o principal canal de processamento que transforma entradas em resultados. É aqui que o “trabalho” acontece, como limpeza de listas, mapeamento, filtragem, lógica de sequências de caracteres, operações de geometria, formatação e conversões.

# group: Normas de nomenclatura de grupo Entradas → Ação → Saídas → Revisão > Saídas
# RESULTADOS FINAIS PRODUZIDOS PELO GRÁFICO, PRONTOS PARA EXPORTAÇÃO OU USO POSTERIOR
# note: USAR: resultados finais destinados a serem usados a jusante (exportados, conectados a outro gráfico), como listas finais, sequências de caracteres formatadas, valores calculados, dicionários/tabelas, dados prontos para exportação

# group: Normas de nomenclatura de grupo Entradas → Ação → Saídas → Revisão > Revisão
# SAÍDAS DE DEPURAÇÃO E VERIFICAÇÃO, USADAS PARA VERIFICAR OS RESULTADOS SEM AFETAR AS SAÍDAS PRINCIPAIS
# note: USAR: verificações legíveis por humanos para poder verificar se o gráfico está fazendo o que você espera, sem alterar os resultados, como nós de inspeção, List.Count, sequências de caracteres de resumo, sinalizadores “APROVADO/FALHA”, listas de erros, geometria de visualização (Watch3D), saídas de exemplo.

# group: Normas de nomenclatura de grupo Entradas → Ação → Saídas → Revisão > Anotações
# note: USAR:
# PARA COMENTÁRIOS E INFORMAÇÕES DE SCRIPTS

# group: Informações do gráfico
# metadados, legenda de código de cores, regras de nomenclatura
# note: PROJETO DO DYNAMO
# Criar um gráfico
# note: VERSÃO DO DYNAMO
# 4.1.0
# note: VERSÃO DO APLICATIVO HOSPEDEIRO
# N/D
# note: ARQUIVOS ASSOCIADOS
# N/D
# note: PACOTES DO DYNAMO NECESSÁRIOS
# N/D
# note: AUTOR(ES)/DATA DE CRIAÇÃO
# Equipe da Archilizer para o Dynamo/4 de fevereiro de 2026
# note: COMENTÁRIOS ADICIONAIS
# N/D
# note: DESCRIÇÃO
# Este documento ajudará você a se familiarizar com um fluxo de trabalho padronizado e as seguintes etapas importantes

# group: COMO CRIAR UM GRÁFICO DO DYNAMO > Informações do gráfico
# metadados, legenda de código de cores, regras de nomenclatura
# note: PROJETO DO DYNAMO
# Consulte as normas de nomenclatura de arquivos de gráficos
# note: VERSÃO DO DYNAMO
# note: VERSÃO DO APLICATIVO HOSPEDEIRO
# note: ARQUIVOS ASSOCIADOS
# note: PACOTES DO DYNAMO NECESSÁRIOS
# note: AUTOR(ES)/DATA DE CRIAÇÃO
# note: COMENTÁRIOS ADICIONAIS
# note: DESCRIÇÃO
# A descrição do gráfico deve indicar
# o que o gráfico faz, quais dados ele usa,
# quais regras ele aplica, o que ele produz,
# onde e como ele é executado (aplicativo hospedeiro + versão) e quaisquer limites importantes

# group: COMO CRIAR UM GRÁFICO DO DYNAMO > Reprodutor do Dynamo Entradas → Ações → Saídas
# O Reprodutor do Dynamo permite que os gráficos do Dynamo sejam executados sem abrir sua interface.
# Os usuários interagem somente com as entradas predefinidas e executam o script
# note: Clique com o botão direito do mouse no nó de entrada e selecione “É entrada”
sua_entrada = StringInput("Reprodutor do Dynamo")  # graph input
sua_ação = String.ToUpper(string=sua_entrada)
# note: Clique com o botão direito do mouse no nó de entrada e selecione “É saída”
sua_saída = Watch(sua_ação)  # graph output

# group: COMO CRIAR UM GRÁFICO DO DYNAMO > Normas de nomenclatura de nós
# note: Não altere todo o nome do nó. Em vez disso, use parênteses no final.
string = StringInput("")
# note: O QUE FAZER
string_entrada_1 = StringInput("")
# note: O QUE NÃO FAZER
# note: Atualize essas regras com base nas normas de seu escritório
entrada_1 = StringInput("")
regras_típicas_do_que_fazer_não = CodeBlock()  # "Regras típicas do que fazer/não fazer"
# ---------- regras_típicas_do_que_fazer_não.designscript (12 lines) ----------
/*
Do:
Rename key nodes only (inputs, rules, outputs, decision logic)
Use notes to add context to your script
Use capitalization consistently (e.g. Title Case or camelCase, not mixed)
*/

/*Do Not:
Rename every node in the graph
Leave important nodes with default names if they affect logic
Use vague names like "Data", "Stuff", "Fix", "Test"
*/;
# ----------------------------------------

# group: COMO CRIAR UM GRÁFICO DO DYNAMO > Normas de nomenclatura de arquivos de gráficos
# Para entender a finalidade ou o uso pretendido de um gráfico por seu nome, sugerimos seguir um padrão de nomenclatura semelhante à convenção do plano de execução de BIM:
string_2 = StringInput("-")
organização = CodeBlock { "AUT"; }
campos_de_função = CodeBlock { BLD  = "BLD"; STR  = "STR"; MEP  = "MEP"; INFR = "INFR"; }
descrição = CodeBlock { "Logical_description"; }
versão_do_dynamo = CodeBlock { "D303"; }
versão_do_script_somente_para = CodeBlock { "V2"; }  # "Versão do script (somente para arquivos de backup)"
ordem_de_montagem = String.Join(separator=string_2, string0=organização, string1=campos_de_função.BLD, string2=descrição, string3=versão_do_dynamo, string4=versão_do_script_somente_para)
exemplo_de_nome = Watch(ordem_de_montagem)
# note: Estrutura de nomenclatura recomendada
estrutura_de_nomenclatura = CodeBlock()
# ---------- estrutura_de_nomenclatura.designscript (3 lines) ----------
["Organisation  | Function fields | Description         | Dynamo-Version | Script-Version",
"AUT            |BLD              | Logical_description | D303           | V3"
];
# ----------------------------------------
# note: NÃO EDITAR:
# note: Os campos de função descrevem a área de trabalho/domínio principal do script
campos_de_função_2 = CodeBlock()
# ---------- campos_de_função_2.designscript (4 lines) ----------
BLD  = "BLD  — Building design";
STR  = "STR  — Structural design";
MEP  = "MEP  — Mechanical / Electrical / Plumbing";
INFR = "INFR — Infrastructure";
# ----------------------------------------

# group: COMO CRIAR UM GRÁFICO DO DYNAMO
# Um guia visual sobre estrutura, nomenclatura e melhores práticas
# note: Usar nós Watch somente em pontos de verificação chave
# Congelar script não ativo
# note: Antes de executar um gráfico:
# Verifique se as entradas estão definidas
# Revise a visualização/verificações
# Execute uma vez manualmente antes de usar o Reprodutor do Dynamo
# Salve o arquivo após a execução
# note: Este documento ajudará você a se familiarizar com um fluxo de trabalho padronizado e com as seguintes etapas importantes
# note: Plano de fundo/painel traseiro
informações = CodeBlock()
# ---------- informações.designscript (5 lines) ----------
"To keep Dynamo graphs neat and readable, we recommend following a clear
structure.

For more information, read the Dynamo Primer page on best-practice graph strategies:
https://primer2.dynamobim.org/9_best_practices/1-graph-strategies";
# ----------------------------------------
