# Dynamo graph Import & Export Workflow.dyn "Importar e exportar fluxo de trabalho" (Dynamo 4.0.0.3076)
# author: Dynamo
# Este documento ajudará você a se familiarizar com diferentes maneiras de importar e exportar arquivos do Excel e CSV.

# group: Informações do gráfico
# metadados, legenda de código de cores, regras de nomenclatura
# note: PROJETO DO DYNAMO
# Fluxo de trabalho de importação e exportação
# note: VERSÃO DO DYNAMO
# 4.2.0
# note: VERSÃO DO APLICATIVO HOSPEDEIRO
# N/D
# note: ARQUIVOS ASSOCIADOS
# N/D
# note: PACOTES DO DYNAMO NECESSÁRIOS
# N/D
# note: AUTOR(ES)/DATA DE CRIAÇÃO
# Equipe da Archilizer para o Dynamo/4 de fevereiro de 2026
# note: COMENTÁRIOS ADICIONAIS
# N/D
# note: DESCRIÇÃO
# Este documento ajudará você a se familiarizar com diferentes maneiras de importar e exportar arquivos do Excel e CSV.
# Somente um método de entrada deve ser usado de cada vez. Congele os scripts que não estão em uso.

# group: Revisão
# SAÍDAS DE DEPURAÇÃO E VERIFICAÇÃO, USADAS PARA VERIFICAR OS RESULTADOS SEM AFETAR AS SAÍDAS PRINCIPAIS
# note: USAR: verificações legíveis para poder conferir se o gráfico está fazendo o que você espera, sem alterar os resultados, como nós de inspeção, List.Count, sequências de caracteres de resumo, sinalizadores “APROVADO/FALHA”, listas de erros, geometria de visualização (Watch3D) e saídas de amostra.

# group: Anotações
# note: USAR:
# PARA COMENTÁRIOS E INFORMAÇÕES DE SCRIPTS.

# group: Saídas
# RESULTADOS FINAIS PRODUZIDOS PELO GRÁFICO, PRONTOS PARA EXPORTAÇÃO OU USO POSTERIOR
# note: USAR: resultados finais destinados a serem usados a jusante (exportados e conectados a outro gráfico), como listas finais, sequências de caracteres formatadas, valores calculados, dicionários/tabelas e dados prontos para exportação.

# group: Entradas
# VALORES CONTROLADOS PELO USUÁRIO QUE DEFINEM OS DADOS E AS CONFIGURAÇÕES DE DESTINO ANTES DE QUALQUER PROCESSAMENTO OCORRER
# note: USAR: todos os valores controlados pelo usuário que definem o que o gráfico processará e como ele deve se comportar.
# Exemplos: controles deslizantes de número, sequências de caracteres, caminhos do arquivo, alternâncias booleanas, menus suspensos e listas iniciais.

# group: Ações
# OPERAÇÕES PRINCIPAIS QUE PROCESSAM AS ENTRADAS
# note: USAR: o principal canal de processamento que transforma entradas em resultados. É aqui que acontece o “trabalho”, como limpeza de listas, mapeamento, filtragem, lógica de sequências de caracteres, operações de geometria, formatação e conversões.

# group: Importação/exportação de CSV
# Esse script importa dados CSV, analisa-os e reestrutura-os com base nas regras de nomenclatura definidas e separa entradas válidas e inválidas para revisão e correção. Neste fluxo de trabalho, uma lista de nomes é processada usando uma lógica de validação baseada em regras, classificada de acordo com convenções de nomenclatura e classificada em grupos válidos e inválidos. Os nomes válidos são exportados para uso posterior, como coordenação e geração de relatórios
# note: Dicas: Adicione um nó de inspeção após a entrada para verificar como o arquivo é importado

# group: Importação/exportação de Excel > Importação do Excel
# Importe dados de um arquivo Excel (.xlsx) para o Dynamo, convertendo linhas e colunas da planilha em listas estruturadas para processamento, validação e manipulação. Os usos comuns incluem cronogramas, parâmetros e quantidades para fluxos de trabalho a jusante
# note: Clique em Procurar e selecione seu próprio arquivo Excel (.xlsx) antes de executar este gráfico
file_path = Filename("Nenhum arquivo selecionado.")
string = StringInput("sheet1")
# note: Definir como false ao ler números.
# Definir como true ao ler texto.
boolean = BoolSelector(false)
openXMLImportExcel = Data.OpenXMLImportExcel(filePath=file_path, sheetName=string, readAsString=boolean)
# note: Usar List.Transpose para ler as colunas da lista.
# Não transpor para ler as linhas da lista.
transpose = List.Transpose()  # unwired: lists

# group: Importação/exportação de Excel > Estruturação de dados para Excel
# remove entradas nulas/vazias e remove cabeçalhos
# note: Recuperar cabeçalhos
deconstruct = List.Deconstruct(list=openXMLImportExcel)
boolean_2 = BoolSelector(false)
clean = List.Clean(list=deconstruct.rest, preserveIndices=boolean_2)

# group: Importação/exportação de Excel > Agrupar por similaridade
# Exemplo de manipulação de dados para Excel
transpose_2 = List.Transpose(lists=clean)
bloco_de_código_índice_de_coluna = CodeBlock { 1; }
# note: Usadas somente para extrair uma única coluna-chave
getItemAtIndex = List.GetItemAtIndex(list=transpose_2, index=bloco_de_código_índice_de_coluna)
number = DoubleInput(0)
boolean_3 = BoolSelector(false)
groupBySimilarity = List.GroupBySimilarity(list=getItemAtIndex, tolerance=number, considerAdjacency=boolean_3)

# group: Importação/exportação de Excel > Extração de coluna de piso
# Confirma o índice da coluna
watch = Watch(getItemAtIndex)

# group: Importação/exportação de CSV > Importação de csv
# Importa dados CSV para o Dynamo e os estrutura para fluxos de trabalho de validação e classificação com base em regras
# note: Clique em Procurar e selecione seu próprio arquivo CSV (.csv) antes de executar este gráfico
file_path_2 = Filename("Nenhum arquivo selecionado.")
boolean_4 = BoolSelector(true)
# note: Transpor a lista caso deseje ler as colunas.
# Não transpor a lista caso deseje ler as linhas
importCSV = Data.ImportCSV(filePath=file_path_2, transpose=boolean_4)

# group: Importação/exportação de CSV > Estruturação de dados para csv
# Estruturação de dados: mescla e limpa a entrada para que as regras a jusante sempre recebam uma lista consistente de sequências de caracteres (sem nulos, sem listas aninhadas, formato limpo).
deconstruct_2 = List.Deconstruct(list=importCSV)
transpose_3 = List.Transpose(lists=deconstruct_2.rest)
code_block_índice_da_coluna_a = CodeBlock { 0; }  # "Code Block (índice da coluna a ser lida)"
getItemAtIndex_2 = List.GetItemAtIndex(list=transpose_3, index=code_block_índice_da_coluna_a)
boolean_5 = BoolSelector(false)
clean_2 = List.Clean(list=getItemAtIndex_2, preserveIndices=boolean_5)

# group: Importação/exportação de CSV > Revisão
# Verificar a extração de cabeçalhos
watch_cabeçalhos = Watch(deconstruct_2.first)

# group: Importação/exportação de CSV > Definições de palavras-chave
# Configurações editáveis pelo usuário que definem as regras de nomenclatura de escritório usadas pelas verificações (maiúsculas, palavras-chave e separador necessário). Atualize-as para corresponderem a seu projeto ou norma do escritório
# note: Editar esta lista para corresponder às convenções de nomenclatura do escritório
toUpper = String.ToUpper(string=clean_2)
code_block = CodeBlock { "-"; }
code_block_2 = CodeBlock()
# ---------- code_block_2.designscript (2 lines) ----------
// uma lista de saída
["GA","DET","STRUCT"];
# ----------------------------------------
code_block_3 = CodeBlock { 0; }
code_block_4 = CodeBlock { 1; }
code_block_5 = CodeBlock { 2; }

# group: Importação/exportação de CSV > Verificações de regras (maiúsculas + separador)
# Gera saídas de regras booleanas por nome. Verifica se cada nome está em maiúsculas e se contém a sequência de caracteres separadora necessária
eq = clean_2 == toUpper
contains = String.Contains(string=clean_2, searchFor=code_block)

# group: Importação/exportação de CSV > Verificação de palavras-chave (contém qualquer palavra-chave)
# Verifica se cada nome contém pelo menos uma palavra-chave aprovada. Retorna uma lista booleana, em que cada item corresponde a um nome.
getItemAtIndex_3 = List.GetItemAtIndex(list=code_block_2, index=code_block_3)
contains_2 = String.Contains(string=clean_2, searchFor=getItemAtIndex_3)
getItemAtIndex_4 = List.GetItemAtIndex(list=code_block_2, index=code_block_4)
contains_3 = String.Contains(string=clean_2, searchFor=getItemAtIndex_4)
or_ = Or(bool0=contains_2, bool1=contains_3)
getItemAtIndex_5 = List.GetItemAtIndex(list=code_block_2, index=code_block_5)
contains_4 = String.Contains(string=clean_2, searchFor=getItemAtIndex_5)
or_2 = Or(bool0=or_, bool1=contains_4)

# group: Importação/exportação de CSV > Combinar verificações na máscara final
# Combina todas as saídas de regra em uma única máscara booleana final usando a lógica AND. Essa máscara define se cada nome é válido ou inválido.
and_ = And(bool0=eq, bool1=contains)
and_2 = And(bool0=and_, bool1=or_2)

# group: Importação/exportação de CSV > Nomes válidos vs. nomes inválidos
# Saídas: divide a lista de nomes de entrada em resultados válidos e inválidos com base na máscara final
filterByBoolMask = List.FilterByBoolMask(list=clean_2, mask=and_2)

# group: Importação/exportação de CSV > Depuração e resumo
# Verificações visuais para confirmar entradas, regras e saídas
nomes_válidos = Watch(filterByBoolMask.in)
nomes_inválidos = Watch(filterByBoolMask.out)

# group: Importação/exportação de CSV > Exportar para CSV
# Exporta os conjuntos de nomes válidos
file_path_3 = Filename("Nenhum arquivo selecionado.")
exportCSV = Data.ExportCSV(filePath=file_path_3, data=filterByBoolMask.in)

# group: Importação/exportação de Excel > Revisão/piso agrupado
# Visualização dos valores de piso agrupados após o agrupamento de similaridade. Usado para verificar o agrupamento correto e a consistência de nomenclatura
watch_2 = Watch(groupBySimilarity.groupedValues)

# group: Importação/exportação de Excel > Revisão/piso agrupado
# Visualização dos valores de piso agrupados após o agrupamento de similaridade. Usado para verificar o agrupamento correto e a consistência de nomenclatura
watch_3 = Watch(groupBySimilarity.groupedIndices)

# group: Importação/exportação de Excel
# Esse script importa dados estruturados do Excel, processa-os e reorganiza-os com base em regras definidas e exporta o resultado transformado para uso externo. Neste fluxo de trabalho, uma lista de ambientes é importada, analisada e reorganizada por localização, agrupando ambientes em listas estruturadas com base em critérios espaciais. Em seguida, os dados processados são exportados para uso na coordenação e na geração de relatórios.
integer_slider = IntegerSlider(1, range=0..2 step 1)

# group: Importação/exportação de Excel > Inserir cabeçalhos antes de exportar (opcional)
# Insere uma linha de cabeçalho no início dos dados exportados.
# note: Usa GroupedIndices para extrair as linhas originais
getItemAtIndex_6 = List.GetItemAtIndex(list=clean, index=groupBySimilarity.groupedIndices)
flatten = List.Flatten(list=getItemAtIndex_6, amount=integer_slider)
integer_slider_2 = IntegerSlider(0, range=0..2 step 1)
# note: Insere cabeçalhos no índice 0 antes da exportação
insert = List.Insert(list=flatten, element=deconstruct.first, index=integer_slider_2)

# group: Importação/exportação de Excel > Estrutura de linhas de revisão/agrupadas
# Verifica a estrutura de linhas aninhadas antes de aplainar e exportar
watch_4 = Watch(insert)

# group: Importação/exportação de Excel > Exportar para Excel
# Exporta dados estruturados do Dynamo  para um arquivo Excel (.xlsx). Suporta saídas para revisão externa e integração com outras ferramentas
# note: O nome do arquivo de exportação deve terminar com .xlsx
# Se já existir um arquivo com o mesmo nome e Substituir estiver definido como false, ocorrerá falha na exportação e nenhum novo arquivo será criado.
# Para substituir um arquivo existente, a opção Substituir deve estar ativada.
caminho_do_arquivo = Filename("Nenhum arquivo selecionado.")
string_2 = StringInput("“Exportar folha”")
integer_slider_3 = IntegerSlider(0, range=0..100 step 1)
boolean_6 = BoolSelector(true)
openXMLExportExcel = Data.OpenXMLExportExcel(filePath=caminho_do_arquivo, sheetName=string_2, data=insert, startRow=integer_slider_3, startColumn=integer_slider_3, writeAsString=boolean_6)

# group: Importação/exportação de geometria > Importação de geometria
# Importa a geometria de um arquivo SAT para o Dynamo e a converte em curvas, superfícies e sólidos editáveis para fluxos de trabalho de transformação
# note: Clique em Procurar e selecione seu próprio arquivo SAT (.sat) antes de executar este gráfico
file_path_4 = Filename("Nenhum arquivo selecionado.")
arquivo_do_caminho = FileObject(path=file_path_4)
unidades = Units("Meters")
# note: Importa o arquivo como sólidos/superfícies/curvas do Dynamo
importFromSATWithUnits = Geometry.ImportFromSATWithUnits(file_filePath=arquivo_do_caminho, dynamoUnit=unidades)
watch_3d_visualização_da = Watch3D(importFromSATWithUnits)  # "Watch 3D (visualização da geometria importada)"

# group: Importação/exportação de geometria > Grupo de depuração/aprendizado
# Mostra o que o Dynamo pensa que cada item é (sólido, superfície, curva etc.).
# Útil se as importações se comportarem de forma inesperada.
type = Object.Type(object=importFromSATWithUnits)
watch_5 = Watch(type)

# group: Importação/exportação de geometria > Transformar
# Dimensiona a geometria importada por um fator uniforme
XY = Plane.XY()
code_block_6 = CodeBlock { 5; }
scale = Geometry.Scale(geometry=importFromSATWithUnits, plane=XY, xamount=code_block_6, yamount=code_block_6, zamount=code_block_6)

# group: Importação/exportação de geometria > Exportar para SAT
# Exporte a geometria atualizada como um arquivo SAT. É possível importar o arquivo SAT para AutoCAD, Revit etc.
file_path_5 = Filename("Nenhum arquivo selecionado.")
exportToSAT = Geometry.ExportToSAT(geometry=scale, filePath=file_path_5)
watch_3d_visualização_da_2 = Watch3D(scale)  # "Watch 3D (visualização da geometria dimensionada)"
