# Dynamo graph Make a Custom Node.dyn "Criar um nó personalizado" (Dynamo 3.0.3.7597)
# author: Dynamo
# Este documento ajudará você a se familiarizar com a criação do nó personalizado.

# group: Informações do gráfico
# metadados, legenda de código de cores, regras de nomenclatura
# note: PROJETO DO DYNAMO
# Criar um nó personalizado
# note: VERSÃO DO DYNAMO
# 4.2.0
# note: VERSÃO DO APLICATIVO HOSPEDEIRO
# N/D
# note: ARQUIVOS ASSOCIADOS
# Curve_Validate.dyf
# note: PACOTES DO DYNAMO NECESSÁRIOS
# N/D
# note: AUTOR(ES)/DATA DE CRIAÇÃO
# Equipe da Archilizer para o Dynamo/4 de fevereiro de 2026
# note: COMENTÁRIOS ADICIONAIS
# Os nós personalizados são normalmente encontrados na seção Complementos da biblioteca.
# Esse nó personalizado está localizado em:
# Complementos → Modelos → Curva → Curve_Validate
# Se não aparecer:
# Verifique se o arquivo .dyf está na pasta de nós personalizados
# Acesse:
# Pacotes → Package Manager → Configurações do pacote → Caminhos de pesquisa de pacotes/bibliotecas
# Verifique se o caminho da pasta está listado ou adicione um novo caminho
# Reinicie o Dynamo após adicionar os novos nós personalizados
# note: DESCRIÇÃO
# Este documento ajudará você a se familiarizar com a criação de nós personalizados.
# Para manter os scripts do Dynamo organizados e legíveis, recomendamos seguir uma
# estrutura clara durante a criação de gráficos.
# Leia mais na página do Dynamo Primer sobre como criar um nó personalizado:
# https://primer2.dynamobim.org/pt-br/6_custom_nodes_and_packages/6-1_custom-nodes/2-creating

# group: DENTRO DO NÓ PERSONALIZADO
# note: Esse script verifica e filtra a geometria da curva usando regras simples. Ele usa curvas de entrada, como linhas, arcos etc., e verifica se cada objeto existe, se é uma curva válida, se atende a uma condição opcional aberta ou fechada e se é maior que um comprimento mínimo escolhido. Em seguida, o nó gera curvas válidas, curvas inválidas e uma máscara de validação booleana mostrando quais curvas passaram ou falharam nas verificações, facilitando a limpeza da geometria, evitando erros em etapas posteriores e preparando os dados para processamento adicional no Dynamo.

# group: Revisão
# SAÍDAS DE DEPURAÇÃO E VERIFICAÇÃO, USADAS PARA VERIFICAR OS RESULTADOS SEM AFETAR AS SAÍDAS PRINCIPAIS
# note: USAR: verificações legíveis para poder conferir se o gráfico está fazendo o que você espera, sem alterar os resultados, como nós de inspeção, List.Count, sequências de caracteres de resumo, sinalizadores “APROVADO/FALHA”, listas de erros, geometria de visualização (Watch3D) e saídas de amostra.

# group: Anotações
# note: USAR:
# PARA COMENTÁRIOS E INFORMAÇÕES DE SCRIPTS.

# group: Saídas
# RESULTADOS FINAIS PRODUZIDOS PELO GRÁFICO, PRONTOS PARA EXPORTAÇÃO OU USO POSTERIOR
# note: USAR: resultados finais destinados a serem usados a jusante (exportados e conectados a outro gráfico), como listas finais, sequências de caracteres formatadas, valores calculados, dicionários/tabelas e dados prontos para exportação.

# group: Entradas
# VALORES CONTROLADOS PELO USUÁRIO QUE DEFINEM OS DADOS E AS CONFIGURAÇÕES DE DESTINO ANTES DE QUALQUER PROCESSAMENTO OCORRER
# note: USAR: todos os valores controlados pelo usuário que definem o que o gráfico processará e como ele deve se comportar.
# Exemplos: controles deslizantes de número, sequências de caracteres, caminhos do arquivo, alternâncias booleanas, menus suspensos e listas iniciais.

# group: Ações
# OPERAÇÕES PRINCIPAIS QUE PROCESSAM AS ENTRADAS
# note: USAR: o principal canal de processamento que transforma entradas em resultados. É aqui que acontece o “trabalho”, como limpeza de listas, mapeamento, filtragem, lógica de sequências de caracteres, operações de geometria, formatação e conversões.

# group: DENTRO DO NÓ PERSONALIZADO > Entradas
# Use esses controles para definir o que significa “válido”.
# As curvas podem ser uma lista de tipos de linhas, arcos, PolyCurves ou curvas mistas.
# Use flattenDepth para controlar como as listas aninhadas são tratadas.
number = DoubleInput(5)
number_2 = DoubleInput(10)
number_3 = DoubleInput(15)
byCoordinates = Point.ByCoordinates(x=number, y=number_2, z=number_3)
byCoordinates_2 = Point.ByCoordinates(x=number_3, y=number, z=number_2)
byCoordinates_3 = Point.ByCoordinates(x=number_2, y=number_3, z=number)
list_create = List.Create(item0=byCoordinates, item1=byCoordinates_2, item2=byCoordinates_3)
byPoints = NurbsCurve.ByPoints(points=list_create)
number_4 = DoubleInput(1)

# group: DENTRO DO NÓ PERSONALIZADO > Validação de tipo e nulo
# Filtra objetos nulos e não curvos antes de executar as verificações da geometria de curva.
# Isso evita avisos e torna o nó mais seguro para entradas mistas.
flatten = List.Flatten(list=byPoints, amount=number_4)
type = Object.Type(object=flatten)
isNull = Object.IsNull(object=flatten)
not_ = Not(x=isNull)

# group: DENTRO DO NÓ PERSONALIZADO > Tipo de geometria a ser considerada
# Geometria semelhante a curva
string = StringInput("Linha")
boolean = BoolSelector(true)
contains = String.Contains(string=type, searchFor=string, ignoreCase=boolean)
string_2 = StringInput("Curva")
contains_2 = String.Contains(string=type, searchFor=string_2, ignoreCase=boolean)
string_3 = StringInput("Arco")
contains_3 = String.Contains(string=type, searchFor=string_3, ignoreCase=boolean)
string_4 = StringInput("PolyCurve")
contains_4 = String.Contains(string=type, searchFor=string_4, ignoreCase=boolean)
or_ = Or(bool0=contains, bool1=contains_2, bool2=contains_3, bool3=contains_4)

# group (continued): DENTRO DO NÓ PERSONALIZADO > Validação de tipo e nulo
and_ = And(bool0=or_, bool1=not_)
filterByBoolMask = List.FilterByBoolMask(list=flatten, mask=and_)

# group: DENTRO DO NÓ PERSONALIZADO > Entradas
# Use esses controles para definir o que significa “válido”.
# minLength é um limite mínimo de comprimento de curva.
# Defina requireClosed como true se as curvas precisarem ser fechadas (ciclos)
number_5 = DoubleInput(5)
boolean_2 = BoolSelector(false)

# group: DENTRO DO NÓ PERSONALIZADO > Verificações de geometria (comprimento e fechamento)
# Aplica regras de curva:
# O comprimento deve ser ≥ minLength
# Se requireClosed for true, a curva deverá ser fechada
length = Curve.Length(curve=filterByBoolMask.in)
# note: As curvas mais curtas que MinLength são inválidas.
ge = length >= number_5
isClosed = Curve.IsClosed(curve=filterByBoolMask.in)
boolean_3 = BoolSelector(true)
if_ = RefactoredIf(test=boolean_2, true=isClosed, false=boolean_3)
and_2 = And(bool0=ge, bool1=if_)

# group: DENTRO DO NÓ PERSONALIZADO > Dividir curvas válidas e inválidas
# Usa a máscara booleana final para separar curvas em listas válidas e inválidas.
filterByBoolMask_2 = List.FilterByBoolMask(list=filterByBoolMask.in, mask=and_2)

# group: DENTRO DO NÓ PERSONALIZADO > Saídas
# validCurves: curvas que passaram na validação
# invalidCurves: curvas que falharam na validação
# maskValid: máscara booleana para filtrar em outro lugar
code_block = CodeBlock(maskValid=and_2)
# ---------- code_block.designscript (4 lines) ----------
// Boolean mask of validation results
 // true  = valid curve
 // false = invalid curve
 maskValid : bool[]..[];
# ----------------------------------------
code_block_2 = CodeBlock(invalidCurves=filterByBoolMask_2.out)
# ---------- code_block_2.designscript (3 lines) ----------
// Curves that failed validation
 // These should not be used for modelling
 invalidCurves : var[]..[];
# ----------------------------------------
code_block_3 = CodeBlock(validCurves=filterByBoolMask_2.in)
# ---------- code_block_3.designscript (3 lines) ----------
// Curves that passed all validation checks
 // These are safe to use for modelling and automation
 validCurves : var[]..[];
# ----------------------------------------

# group: Entradas
# Use esses controles para definir o que significa “válido”.
# As curvas podem ser uma lista de tipos de linhas, arcos, PolyCurves ou curvas mistas.
# Use flattenDepth para controlar como as listas aninhadas são tratadas
number_6 = DoubleInput(5)
boolean_4 = BoolSelector(false)
number_7 = DoubleInput(5)
number_8 = DoubleInput(10)
number_9 = DoubleInput(15)
byCoordinates_4 = Point.ByCoordinates(x=number_7, y=number_8, z=number_9)
byCoordinates_5 = Point.ByCoordinates(x=number_9, y=number_7, z=number_8)
byCoordinates_6 = Point.ByCoordinates(x=number_8, y=number_9, z=number_7)
list_create_2 = List.Create(item0=byCoordinates_4, item1=byCoordinates_5, item2=byCoordinates_6)
byPoints_2 = NurbsCurve.ByPoints(points=list_create_2)
number_10 = DoubleInput(1)

# group: NÓ PERSONALIZADO
# Clique duas vezes no nó para expandi-lo e abrir o arquivo dyf.
# note: Essa lógica é compactada como um nó personalizado para tornar a verificação de curvas simples, reutilizável e consistente em diferentes gráficos do Dynamo. Em vez de criar sempre as mesmas etapas de validação, as regras estão contidas em uma ferramenta clara que pode ser reutilizada, atualizada e compartilhada facilmente. Isso reduz erros, mantém os gráficos organizados e legíveis
curve_Validate = Custom[Curve_Validate](minLength=number_6, requireClosed=boolean_4, curveLikeGeometry=byPoints_2, flattenDepth=number_10)  # Valida a geometria da curva ao verificar o seguinte:nulos, tipo, tolerância de comprimento e fechamento opcional. Retorna as curvas válidas/inválidas, a máscara booleana e os motivos de falha.

# group: Saídas
# Mostra curvas válidas, curvas inválidas e a máscara de validação.
watch = Watch(curve_Validate.invalidCurves)
watch_2 = Watch(curve_Validate.validCurves)
watch_3 = Watch(curve_Validate.maskValid)
