# Dynamo graph Create a Graph.dyn "Создание графика" (Dynamo 4.0.0.3076)
# author: Dynamo
# Этот документ поможет ознакомиться со стандартным рабочим процессом и следующими важными шагами.

# group: СОЗДАНИЕ ГРАФА DYNAMO > Пример
# note: Генератор имен

# group: Стандарты именования групп Входные данные → Действие → Выходные данные → Просмотр > Входные данные
# КОНТРОЛИРУЕМЫЕ ПОЛЬЗОВАТЕЛЕМ ЗНАЧЕНИЯ, КОТОРЫЕ ОПРЕДЕЛЯЮТ ЦЕЛЕВЫЕ ДАННЫЕ И ПАРАМЕТРЫ ПЕРЕД ЛЮБОЙ ОБРАБОТКОЙ
# note: ИСПОЛЬЗОВАНИЕ: все контролируемые пользователем значения, которые определяют, какие элементы будут обрабатываться графом и как он должен себя вести.
# Например, регуляторы чисел, строки, пути к файлам, логические переключатели, раскрывающиеся списки, начальные списки.

# group: Стандарты именования групп Входные данные → Действие → Выходные данные → Просмотр > Действия
# ОСНОВНЫЕ ОПЕРАЦИИ, КОТОРЫЕ ОБРАБАТЫВАЮТ ВХОДНЫЕ ДАННЫЕ
# note: ИСПОЛЬЗОВАНИЕ: основной рабочий процесс, который преобразует входные данные в результаты. Именно здесь происходит «работа», такая как очистка списка, сопоставление, фильтрация, строковая логика, операции с геометрией, форматирование, преобразования.

# group: Стандарты именования групп Входные данные → Действие → Выходные данные → Просмотр > Выходные данные
# ОКОНЧАТЕЛЬНЫЕ РЕЗУЛЬТАТЫ, ПОЛУЧЕННЫЕ С ПОМОЩЬЮ ГРАФА, ГОТОВЫЕ ДЛЯ ЭКСПОРТА ИЛИ ПОСЛЕДУЮЩЕГО ИСПОЛЬЗОВАНИЯ
# note: ИСПОЛЬЗОВАНИЕ: окончательные результаты, предназначенные для использования в последующих процессах (экспорт, вставка в другой граф), например окончательные списки, форматированные строки, вычисляемые значения, словари/таблицы, готовые к экспорту данные

# group: Стандарты именования групп Входные данные → Действие → Выходные данные → Просмотр > Просмотр
# ОТЛАДКА И ПРОВЕРКА ВЫХОДНЫХ ДАННЫХ, КОТОРЫЕ ИСПОЛЬЗУЮТСЯ ДЛЯ ПРОВЕРКИ РЕЗУЛЬТАТОВ БЕЗ ВОЗДЕЙСТВИЯ НА ОСНОВНЫЕ ВЫХОДНЫЕ ДАННЫЕ
# note: ИСПОЛЬЗОВАНИЕ: удобочитаемые проверки, позволяющие убедиться в том, что граф соответствует ожиданиям, без изменения результатов, таких как узлы Watch, List.Count, строки сводки, флажки PASS/FAIL, списки ошибок, предварительный просмотр геометрии (Watch3D), примеры выходных данных.

# group: Стандарты именования групп Входные данные → Действие → Выходные данные → Просмотр > Аннотации
# note: ИСПОЛЬЗОВАНИЕ:
# ДЛЯ КОММЕНТАРИЕВ И СВЕДЕНИЙ О СЦЕНАРИИ

# group: Информация о графе
# метаданные, легенда цветовых кодов, правила именования
# note: ПРОЕКТ DYNAMO
# Создание графа
# note: DYNAMO VERSION
# 4.2.0
# note: ВЕРСИЯ ОСНОВНОГО ПРИЛОЖЕНИЯ
# Н/Д
# note: СВЯЗАННЫЕ ФАЙЛЫ
# Н/Д
# note: НЕОБХОДИМЫЕ ПАКЕТЫ DYNAMO
# Н/Д
# note: АВТОРЫ/ДАТА СОЗДАНИЯ
# Archilizer для команды разработчиков Dynamo / 4 февраля 2026 г.
# note: ДОПОЛНИТЕЛЬНЫЕ КОММЕНТАРИИ
# Н/Д
# note: ОПИСАНИЕ
# Этот документ поможет ознакомиться со стандартным рабочим процессом и следующими важными шагами

# group: СОЗДАНИЕ ГРАФА DYNAMO > Информация о графе
# метаданные, легенда цветовых кодов, правила именования
# note: ПРОЕКТ DYNAMO
# См. раздел «Стандарты именования файлов графов»
# note: ВЕРСИЯ DYNAMO
# note: ВЕРСИЯ ОСНОВНОГО ПРИЛОЖЕНИЯ
# note: СВЯЗАННЫЕ ФАЙЛЫ
# note: НЕОБХОДИМЫЕ ПАКЕТЫ DYNAMO
# note: АВТОРЫ/ДАТА СОЗДАНИЯ
# note: ДОПОЛНИТЕЛЬНЫЕ КОММЕНТАРИИ
# note: ОПИСАНИЕ
# В описании графа должно быть указано,
# что делает граф, какие данные он использует,
# какие правила применяет, что выводит,
# где и как запускается (основное приложение + версия), а также любые ключевые ограничения

# group: СОЗДАНИЕ ГРАФА DYNAMO > Проигрыватель Dynamo Входные данные → Действия → Выходные данные
# Проигрыватель Dynamo позволяет запускать графы Dynamo без открытия интерфейса Dynamo.
# Пользователи взаимодействуют только с предварительно определенными входными данными и выполняют сценарий
# note: Щелкните правой кнопкой мыши узел ввода и выберите «Является вводом»
входные_данные = StringInput("Проигрыватель Dynamo")  # graph input
ваше_действие = String.ToUpper(string=входные_данные)
# note: Щелкните правой кнопкой мыши узел ввода и выберите «Является выводом»
выходные_данные = Watch(ваше_действие)  # graph output

# group: СОЗДАНИЕ ГРАФА DYNAMO > Стандарты именования узлов
# note: Не изменяйте имя узла целиком. Вместо этого используйте скобки в конце.
строка = StringInput("")
# note: МОЖНО
строка_входные_данные_1 = StringInput("")
# note: НЕЛЬЗЯ
# note: Обновите эти правила в соответствии со стандартами своей организации
входные_данные_1 = StringInput("")
типовые_правила_относительно = CodeBlock()  # "Типовые правила относительно того, что можно и нельзя делать"
# ---------- типовые_правила_относительно.designscript (12 lines) ----------
/*
Do:
Rename key nodes only (inputs, rules, outputs, decision logic)
Use notes to add context to your script
Use capitalization consistently (e.g. Title Case or camelCase, not mixed)
*/

/*Do Not:
Rename every node in the graph
Leave important nodes with default names if they affect logic
Use vague names like "Data", "Stuff", "Fix", "Test"
*/;
# ----------------------------------------

# group: СОЗДАНИЕ ГРАФА DYNAMO > Стандарты именования файлов графов
# Чтобы понять назначение и предполагаемое использование графа по его имени, рекомендуется следовать схеме именования, аналогичной общепринятой в плане выполнения BIM:
строка_2 = StringInput("-")
организация = CodeBlock { "AUT"; }
поля_функции = CodeBlock { BLD  = "BLD"; STR  = "STR"; MEP  = "MEP"; INFR = "INFR"; }
описание = CodeBlock { "Logical_description"; }
версия_dynamo = CodeBlock { "D303"; }
версия_сценария_только_для = CodeBlock { "V2"; }  # "Версия сценария (только для файлов резервных копий)"
порядок_сборки = String.Join(separator=строка_2, string0=организация, string1=поля_функции.BLD, string2=описание, string3=версия_dynamo, string4=версия_сценария_только_для)
пример_имени = Watch(порядок_сборки)
# note: Рекомендуемая структура именования
структура_именования = CodeBlock()
# ---------- структура_именования.designscript (3 lines) ----------
["Organisation  | Function fields | Description         | Dynamo-Version | Script-Version",
"AUT            |BLD              | Logical_description | D303           | V3"
];
# ----------------------------------------
# note: НЕ РЕДАКТИРУЙТЕ:
# note: Поля функции описывают основную рабочую область/предметную область сценария
поля_функции_2 = CodeBlock()
# ---------- поля_функции_2.designscript (4 lines) ----------
BLD  = "BLD  — Building design";
STR  = "STR  — Structural design";
MEP  = "MEP  — Mechanical / Electrical / Plumbing";
INFR = "INFR — Infrastructure";
# ----------------------------------------

# group: СОЗДАНИЕ ГРАФА DYNAMO
# Наглядное руководство по структуре и именованию, а также практические советы
# note: Используйте узлы Watch только в ключевых контрольных точках
# Заморозьте неактивный сценарий
# note: Перед запуском графа:
# Убедитесь, что заданы входные данные
# Предварительно просмотрите/выполните проверки
# Запустите вручную один раз перед использованием проигрывателя Dynamo
# Сохраните файл после успешного выполнения
# note: Этот документ поможет ознакомиться со стандартным рабочим процессом и следующими важными шагами
# note: Фон/задняя панель
информация = CodeBlock()
# ---------- информация.designscript (5 lines) ----------
"To keep Dynamo graphs neat and readable, we recommend following a clear
structure.

For more information, read the Dynamo Primer page on best-practice graph strategies:
https://primer2.dynamobim.org/9_best_practices/1-graph-strategies";
# ----------------------------------------
