# Dynamo graph Import & Export Workflow.dyn "Рабочий процесс импорта и экспорта" (Dynamo 4.0.0.3076)
# author: Dynamo
# Этот документ поможет ознакомиться с различными способами импорта и экспорта файлов Excel и CSV.

# group: Определения ключевых слов > Аннотации
# note: Редактирование этого списка в соответствии с соглашениями об именовании офисов

# group: Информация о графе
# метаданные, легенда цветовых кодов, правила именования
# note: ПРОЕКТ DYNAMO
# Рабочий процесс импорта и экспорта
# note: ВЕРСИЯ DYNAMO
# 4.1.0
# note: ВЕРСИЯ ОСНОВНОГО ПРИЛОЖЕНИЯ
# Н/Д
# note: СВЯЗАННЫЕ ФАЙЛЫ
# Excel_Import_Example.xlsx
# CSV_Import_Example.csv
# Geometry_Import_Example.sat
# note: НЕОБХОДИМЫЕ ПАКЕТЫ DYNAMO
# Н/Д
# note: АВТОРЫ/ДАТА СОЗДАНИЯ
# Archilizer для команды разработчиков Dynamo / 4 февраля 2026 г.
# note: ДОПОЛНИТЕЛЬНЫЕ КОММЕНТАРИИ
# Н/Д
# note: ОПИСАНИЕ
# Этот документ поможет ознакомиться с различными способами импорта и экспорта файлов Excel и CSV.
# Одновременно следует использовать только один метод ввода. Заморозьте неиспользуемые сценарии.

# group: Просмотр
# ОТЛАДКА И ПРОВЕРКА ВЫХОДНЫХ ДАННЫХ, КОТОРЫЕ ИСПОЛЬЗУЮТСЯ ДЛЯ ПРОВЕРКИ РЕЗУЛЬТАТОВ БЕЗ ВОЗДЕЙСТВИЯ НА ОСНОВНЫЕ ВЫХОДНЫЕ ДАННЫЕ
# note: ИСПОЛЬЗОВАНИЕ: удобочитаемые проверки, позволяющие убедиться в том, что граф соответствует ожиданиям, без изменения результатов, таких как узлы Watch, List.Count, строки сводки, флажки PASS/FAIL, списки ошибок, геометрия предварительного просмотра (Watch3D) и примеры выходных данных.

# group: Аннотации
# note: ИСПОЛЬЗОВАНИЕ:
# ДЛЯ КОММЕНТАРИЕВ И ИНФОРМАЦИИ О СЦЕНАРИИ.

# group: Выходные данные
# ОКОНЧАТЕЛЬНЫЕ РЕЗУЛЬТАТЫ, ПОЛУЧЕННЫЕ С ПОМОЩЬЮ ГРАФА, ГОТОВЫЕ ДЛЯ ЭКСПОРТА ИЛИ ПОСЛЕДУЮЩЕГО ИСПОЛЬЗОВАНИЯ
# note: ИСПОЛЬЗОВАНИЕ: окончательные результаты, предназначенные для использования в последующих процессах (экспорт, вставка в другой граф), например окончательные списки, форматированные строки, вычисляемые значения, словари/таблицы, готовые к экспорту данные.

# group: Входные данные
# КОНТРОЛИРУЕМЫЕ ПОЛЬЗОВАТЕЛЕМ ЗНАЧЕНИЯ, КОТОРЫЕ ОПРЕДЕЛЯЮТ ЦЕЛЕВЫЕ ДАННЫЕ И ПАРАМЕТРЫ ПЕРЕД ЛЮБОЙ ОБРАБОТКОЙ
# note: ИСПОЛЬЗОВАНИЕ: все контролируемые пользователем значения, которые определяют, какие элементы будут обрабатываться графом и как он должен себя вести.
# Например, регуляторы чисел, строки, пути к файлам, логические переключатели, раскрывающиеся списки, начальные списки.

# group: Действия
# ОСНОВНЫЕ ОПЕРАЦИИ, КОТОРЫЕ ОБРАБАТЫВАЮТ ВХОДНЫЕ ДАННЫЕ
# note: ИСПОЛЬЗОВАНИЕ: основной рабочий процесс, который преобразует входные данные в результаты. Именно здесь происходит «работа», такая как очистка списка, сопоставление, фильтрация, строковая логика, операции с геометрией, форматирование, преобразования.

# group: Импорт/экспорт в CSV
# Этот сценарий импортирует данные CSV, анализирует и реструктурирует их в соответствии с определенными правилами именования, а также разделяет допустимые и недопустимые записи для проверки и исправления. В этом рабочем процессе список имен обрабатывается с помощью логики проверки на основе правил, сортируется в соответствии с соглашениями об именовании и классифицируется по допустимым и недопустимым группам. Допустимые имена экспортируются для использования на последующих этапах, например для координации и создания отчетов
# note: Транспонировать список, если требуется прочитать столбцы.
# Не транспонировать список, если требуется прочитать строки
# note: Совет. Добавьте узел Watch после ввода, чтобы проверить, как импортируется файл

# group: Импорт из Excel
# Задайте значение False при чтении чисел.
# Задайте значение True при чтении текста.
boolean = BoolSelector(false)

# group: Импорт из Excel
# Данные из файла Excel (XLSX) можно импортировать в Dynamo, преобразуя строки и столбцы электронной таблицы в структурированные списки для обработки, проверки и обработки. Распространенные области применения: спецификации, параметры и количественные характеристики для последующих рабочих процессов
путь_к_файлу = Filename("..\..\..\..\..\..\Desktop\Excel_Import_Example.xlsx")
string = StringInput("sheet1")
openXMLImportExcel = Data.OpenXMLImportExcel(filePath=путь_к_файлу, sheetName=string, readAsString=boolean)
# note: Используйте узел List.Transpose для чтения столбцов в списке.
# Не транспонируйте для чтения строк вашего списка.
transpose = List.Transpose()  # unwired: lists

# group: Импорт/экспорт в Excel > Структурирование данных для Excel
# Удаление значений NULL или пустых записей, а также заголовков
# note: Извлечь заголовки
deconstruct = List.Deconstruct(list=openXMLImportExcel)
boolean_2 = BoolSelector(false)
clean = List.Clean(list=deconstruct.rest, preserveIndices=boolean_2)

# group: Импорт/экспорт в Excel > Группировать по сходству
# Пример операции с данными в Excel
transpose_2 = List.Transpose(lists=clean)
code_block_индекс_столбца = CodeBlock { 1; }
# note: Используется только для извлечения одного ключевого столбца
getItemAtIndex = List.GetItemAtIndex(list=transpose_2, index=code_block_индекс_столбца)
number = DoubleInput(0)
boolean_3 = BoolSelector(false)
groupBySimilarity = List.GroupBySimilarity(list=getItemAtIndex, tolerance=number, considerAdjacency=boolean_3)

# group: Импорт/экспорт в Excel > Извлечение наименьшего столбца
# Подтверждение индекса столбцов
watch = Watch(getItemAtIndex)

# group: Импорт/экспорт в CSV > Импорт CSV
# Импорт данных CSV в Dynamo и их структурирование для проверки, сортировки и классификации на основе правил
путь_к_файлу_2 = Filename("..\Data\CSV_Import_Example.csv")
boolean_4 = BoolSelector(true)
importCSV = Data.ImportCSV(filePath=путь_к_файлу_2, transpose=boolean_4)

# group: Импорт/экспорт в CSV > Структурирование данных для CSV
# Структурирование данных: объединение и очистка входных данных, поэтому нижестоящие правила всегда получают согласованный список строк (без значений NULL, без вложенных списков, чистый формат).
deconstruct_2 = List.Deconstruct(list=importCSV)
transpose_3 = List.Transpose(lists=deconstruct_2.rest)
code_block_индекс_столбца_для = CodeBlock { 0; }  # "Code Block (индекс столбца для чтения)"
getItemAtIndex_2 = List.GetItemAtIndex(list=transpose_3, index=code_block_индекс_столбца_для)
boolean_5 = BoolSelector(false)
clean_2 = List.Clean(list=getItemAtIndex_2, preserveIndices=boolean_5)

# group: Импорт/экспорт в CSV > Просмотр
# Проверка извлечения заголовков
watch_заголовки = Watch(deconstruct_2.first)

# group: Определения ключевых слов
# Редактируемые пользователем параметры, определяющие правила именования офиса, используемые при проверке (верхний регистр, ключевые слова и обязательный разделитель). Обновите их в соответствии со стандартами проекта или организации
toUpper = String.ToUpper(string=clean_2)
code_block = CodeBlock { "-"; }
code_block_2 = CodeBlock()
# ---------- code_block_2.designscript (2 lines) ----------
// one output list
["GA","DET","STRUCT"];
# ----------------------------------------
code_block_3 = CodeBlock { 0; }
code_block_4 = CodeBlock { 1; }
code_block_5 = CodeBlock { 2; }

# group: Импорт/экспорт в CSV > Проверка правил (верхний регистр + разделитель)
# Генерирует выходные данные логического правила для каждого имени. Проверка регистра каждого имени и наличия в нем требуемой разделительной строки
eq = clean_2 == toUpper
contains = String.Contains(string=clean_2, searchFor=code_block)

# group: Импорт/экспорт в CSV > Проверка по ключевым словам (содержит любое ключевое слово)
# Проверка того, содержит ли каждое имя хотя бы одно утвержденное ключевое слово. Вывод логического списка, в котором каждый элемент соответствует совпадающему имени.
getItemAtIndex_3 = List.GetItemAtIndex(list=code_block_2, index=code_block_3)
contains_2 = String.Contains(string=clean_2, searchFor=getItemAtIndex_3)
getItemAtIndex_4 = List.GetItemAtIndex(list=code_block_2, index=code_block_4)
contains_3 = String.Contains(string=clean_2, searchFor=getItemAtIndex_4)
or_ = Or(bool0=contains_2, bool1=contains_3)
getItemAtIndex_5 = List.GetItemAtIndex(list=code_block_2, index=code_block_5)
contains_4 = String.Contains(string=clean_2, searchFor=getItemAtIndex_5)
or_2 = Or(bool0=or_, bool1=contains_4)

# group: Импорт/экспорт в CSV > Объединение проверок в окончательную маску
# Объединение всех выходных данных правила в одну окончательную логическую маску с помощью логики «И». Эта маска определяет, является ли каждое имя допустимым или недопустимым.
and_ = And(bool0=eq, bool1=contains)
and_2 = And(bool0=and_, bool1=or_2)

# group: Импорт/экспорт в CSV > Допустимые и недопустимые имена
# Выходные данные: разбивка списка имен входных данных на допустимые и недопустимые результаты на основе окончательной маски
filterByBoolMask = List.FilterByBoolMask(list=clean_2, mask=and_2)

# group: Импорт/экспорт в CSV > Отладка и сводка
# Визуальные проверки для подтверждения входных данных, правил и выходных данных
valid_names = Watch(filterByBoolMask.in)
invalid_names = Watch(filterByBoolMask.out)

# group: Импорт/экспорт в CSV > Экспорт в CSV
# Экспорт действительных наборов с именем
путь_к_файлу_3 = Filename("..\..\..\..\..\..\Desktop\CSV_Export_Example")
exportCSV = Data.ExportCSV(filePath=путь_к_файлу_3, data=filterByBoolMask.in)

# group: Импорт/экспорт в Excel > Проверка сгруппированных наименьших значений
# Предварительный просмотр сгруппированных наименьших значений после кластеризации по сходству. Используется для проверки правильности группировки и согласованности имен
watch_2 = Watch(groupBySimilarity.groupedValues)

# group: Импорт/экспорт в Excel > Проверка сгруппированных наименьших значений
# Предварительный просмотр сгруппированных наименьших значений после кластеризации по сходству. Используется для проверки правильности группировки и согласованности имен
watch_3 = Watch(groupBySimilarity.groupedIndices)

# group: Импорт/экспорт в Excel
# Этот сценарий импортирует структурированные данные из Excel, обрабатывает и реорганизует их в соответствии с заданными правилами, а затем экспортирует преобразованный результат для внешнего использования. В этом рабочем процессе список помещений импортируется, анализируется и переупорядочивается по местоположению с группированием помещений в структурированные списки на основе пространственных критериев. Обработанные данные затем экспортируются для использования в координации и отчетах.
integer_slider = IntegerSlider(1, range=0..2 step 1)

# group: Импорт/экспорт в Excel > Вставить заголовки перед экспортом (необязательно)
# Вставка строки заголовка в начало экспортируемых данных.
# note: Использование GroupedIndices для извлечения исходных строк
getItemAtIndex_6 = List.GetItemAtIndex(list=clean, index=groupBySimilarity.groupedIndices)
flatten = List.Flatten(list=getItemAtIndex_6, amount=integer_slider)
integer_slider_2 = IntegerSlider(0, range=0..2 step 1)
# note: Вставка заголовков с индексом 0 перед экспортом
insert = List.Insert(list=flatten, element=deconstruct.first, index=integer_slider_2)

# group: Импорт/экспорт в Excel > Просмотр/структура сгруппированных строк
# Проверка вложенной структуры строк перед выравниванием и экспортом
watch_4 = Watch(insert)

# group: Импорт/экспорт в Excel > Экспорт в Excel
# Экспорт структурированных данных Dynamo в Excel (XLSX). Поддержка вывода для внешней проверки и интеграции с другими инструментами
# note: Имя файла экспорта должно заканчиваться на .xlsx
# Если файл с таким именем уже существует, а для параметра перезаписи задано значение False, экспорт не будет выполнен и новый файл не будет создан.
# Для замены существующего файла необходимо включить функцию перезаписи.
путь_к_файлу_4 = Filename("..\..\..\..\..\..\Desktop\Excel_Export_Example.xlsx")
string_2 = StringInput("\"Лист для экспорта\"")
integer_slider_3 = IntegerSlider(0, range=0..100 step 1)
boolean_6 = BoolSelector(true)
openXMLExportExcel = Data.OpenXMLExportExcel(filePath=путь_к_файлу_4, sheetName=string_2, data=insert, startRow=integer_slider_3, startColumn=integer_slider_3, writeAsString=boolean_6)

# group: Импорт/экспорт геометрии > Импорт геометрии
# Импорт геометрии из файла SAT в Dynamo и ее преобразование в редактируемые кривые, поверхности и тела для использования в рабочих процессах преобразования
путь_к_файлу_5 = Filename("..\..\..\..\..\..\Desktop\Geometry_Import_Example.sat")
file_from_path = FileObject(path=путь_к_файлу_5)
units = Units("Метры")
# note: Импорт файла как тел/поверхностей/кривых Dynamo
importFromSATWithUnits = Geometry.ImportFromSATWithUnits(file_filePath=file_from_path, dynamoUnit=units)
watch_3d_предварительный = Watch3D(importFromSATWithUnits)  # "Watch 3D (предварительный просмотр импортированной геометрии)"

# group: Импорт/экспорт геометрии > Отладка/группа обучения
# Отображение того, что, по мнению Dynamo, представляет собой каждый элемент (тело, поверхность, кривая и т. д.).
# Полезно при неожиданном поведении импорта.
type = Object.Type(object=importFromSATWithUnits)
watch_5 = Watch(type)

# group: Импорт/экспорт геометрии > Преобразовать
# Равномерное масштабирование импортированной геометрии
XY = Plane.XY()
code_block_6 = CodeBlock { 5; }
scale = Geometry.Scale(geometry=importFromSATWithUnits, plane=XY, xamount=code_block_6, yamount=code_block_6, zamount=code_block_6)

# group: Импорт/экспорт геометрии > Экспорт в SAT
# Экспорт обновленной геометрии в файл SAT, который можно импортировать в AutoCAD, Revit и т. д.
путь_к_файлу_6 = Filename("..\..\..\..\..\..\Desktop\Geometry_Export_Example.sat")
exportToSAT = Geometry.ExportToSAT(geometry=scale, filePath=путь_к_файлу_6)
watch_3d_предварительный_2 = Watch3D(scale)  # "Watch 3D (предварительный просмотр масштабированной геометрии)"
