# Dynamo graph Make a Custom Node.dyn "Создание пользовательского узла" (Dynamo 3.0.3.7597)
# author: Dynamo
# Этот документ поможет ознакомиться с процедурой создания пользовательского узла.

# group: Информация о графе
# метаданные, легенда цветовых кодов, правила именования
# note: ПРОЕКТ DYNAMO
# Создание пользовательского узла
# note: DYNAMO VERSION
# 4.2.0
# note: ВЕРСИЯ ОСНОВНОГО ПРИЛОЖЕНИЯ
# Н/Д
# note: СВЯЗАННЫЕ ФАЙЛЫ
# Curve_Validate.dyf
# note: НЕОБХОДИМЫЕ ПАКЕТЫ DYNAMO
# Н/Д
# note: АВТОРЫ/ДАТА СОЗДАНИЯ
# Archilizer для команды разработчиков Dynamo / 4 февраля 2026 г.
# note: ДОПОЛНИТЕЛЬНЫЕ КОММЕНТАРИИ
# Пользовательские узлы обычно находятся в разделе Add-ons библиотеки.
# Этот пользовательский узел находится в папке:
# Add-ons → Templates → Curve → Curve_Validate
# Если он не отображается:
# Убедитесь, что файл DYF находится в папке пользовательских узлов
# Перейдите в раздел:
# Пакеты → Package Manager → Параметры пакета → Пути поиска пакетов/библиотек
# Убедитесь, что путь к папке указан в списке, или добавьте новый путь
# Перезапустите Dynamo после добавления новых пользовательских узлов
# note: ОПИСАНИЕ
# Этот документ поможет ознакомиться с процедурой создания пользовательского узла.
# Чтобы сценарии Dynamo были аккуратными и удобными для чтения, рекомендуется следовать четкой
# структуре при создании графов.
# Дополнительные сведения см. на странице Dynamo Primer, посвященной созданию пользовательского узла:
# https://primer2.dynamobim.org/ru/6_custom_nodes_and_packages/6-1_custom-nodes/2-creating

# group: ВНУТРИ ПОЛЬЗОВАТЕЛЬСКОГО УЗЛА
# note: Этот сценарий проверяет и фильтрует геометрию кривых с помощью простых правил. Выполняется проверка наличия входных кривых, например линий, дуг и т. д., допустимости для каждого объекта, его соответствия необязательному условию разомкнутости или замкнутости и превышения выбранной минимальной длины. Затем узел выводит допустимые и недопустимые кривые и логическую маску проверки, показывающую, какие кривые прошли или не прошли проверку. Это упрощает очистку геометрии, позволяет избежать ошибок на последующих этапах и подготовить данные для дальнейшей обработки в Dynamo.

# group: Просмотр
# ОТЛАДКА И ПРОВЕРКА ВЫХОДНЫХ ДАННЫХ, КОТОРЫЕ ИСПОЛЬЗУЮТСЯ ДЛЯ ПРОВЕРКИ РЕЗУЛЬТАТОВ БЕЗ ВОЗДЕЙСТВИЯ НА ОСНОВНЫЕ ВЫХОДНЫЕ ДАННЫЕ
# note: ИСПОЛЬЗОВАНИЕ: удобочитаемые проверки, позволяющие убедиться в том, что граф соответствует ожиданиям, без изменения результатов, таких как узлы Watch, List.Count, строки сводки, флажки PASS/FAIL, списки ошибок, геометрия предварительного просмотра (Watch3D) и примеры выходных данных.

# group: Аннотации
# note: ИСПОЛЬЗОВАНИЕ:
# ДЛЯ КОММЕНТАРИЕВ И ИНФОРМАЦИИ О СЦЕНАРИИ.

# group: Выходные данные
# ОКОНЧАТЕЛЬНЫЕ РЕЗУЛЬТАТЫ, ПОЛУЧЕННЫЕ С ПОМОЩЬЮ ГРАФА, ГОТОВЫЕ ДЛЯ ЭКСПОРТА ИЛИ ПОСЛЕДУЮЩЕГО ИСПОЛЬЗОВАНИЯ
# note: ИСПОЛЬЗОВАНИЕ: окончательные результаты, предназначенные для использования в последующих процессах (экспорт, вставка в другой граф), например окончательные списки, форматированные строки, вычисляемые значения, словари/таблицы, готовые к экспорту данные.

# group: Входные данные
# КОНТРОЛИРУЕМЫЕ ПОЛЬЗОВАТЕЛЕМ ЗНАЧЕНИЯ, КОТОРЫЕ ОПРЕДЕЛЯЮТ ЦЕЛЕВЫЕ ДАННЫЕ И ПАРАМЕТРЫ ПЕРЕД ЛЮБОЙ ОБРАБОТКОЙ
# note: ИСПОЛЬЗОВАНИЕ: все контролируемые пользователем значения, которые определяют, какие элементы будут обрабатываться графом и как он должен себя вести.
# Например, регуляторы чисел, строки, пути к файлам, логические переключатели, раскрывающиеся списки, начальные списки.

# group: Действия
# ОСНОВНЫЕ ОПЕРАЦИИ, КОТОРЫЕ ОБРАБАТЫВАЮТ ВХОДНЫЕ ДАННЫЕ
# note: ИСПОЛЬЗОВАНИЕ: основной рабочий процесс, который преобразует входные данные в результаты. Именно здесь происходит «работа», такая как очистка списка, сопоставление, фильтрация, строковая логика, операции с геометрией, форматирование, преобразования.

# group: ВНУТРИ ПОЛЬЗОВАТЕЛЬСКОГО УЗЛА > Входные данные
# Используйте эти элементы управления, чтобы определить, что означает «допустимый».
# Кривые могут представлять собой список линий, дуг, объектов PolyCurve или смешанных типов кривых.
# Используйте FlattenDepth для управления обработкой вложенных списков.
number = DoubleInput(5)
number_2 = DoubleInput(10)
number_3 = DoubleInput(15)
byCoordinates = Point.ByCoordinates(x=number, y=number_2, z=number_3)
byCoordinates_2 = Point.ByCoordinates(x=number_3, y=number, z=number_2)
byCoordinates_3 = Point.ByCoordinates(x=number_2, y=number_3, z=number)
list_create = List.Create(item0=byCoordinates, item1=byCoordinates_2, item2=byCoordinates_3)
byPoints = NurbsCurve.ByPoints(points=list_create)
number_4 = DoubleInput(1)

# group: ВНУТРИ ПОЛЬЗОВАТЕЛЬСКОГО УЗЛА > Проверка объектов NULL и проверка типа
# Фильтрация объектов NULL и некриволинейных объектов перед выполнением проверки геометрии кривой.
# Это предотвращает появление предупреждений и делает узел более безопасным для смешанных входных данных.
flatten = List.Flatten(list=byPoints, amount=number_4)
type = Object.Type(object=flatten)
isNull = Object.IsNull(object=flatten)
not_ = Not(x=isNull)

# group: ВНУТРИ ПОЛЬЗОВАТЕЛЬСКОГО УЗЛА > Тип учитываемой геометрии
# Геометрия, похожая на кривую
string = StringInput("Отрезок")
boolean = BoolSelector(true)
contains = String.Contains(string=type, searchFor=string, ignoreCase=boolean)
string_2 = StringInput("Кривая")
contains_2 = String.Contains(string=type, searchFor=string_2, ignoreCase=boolean)
string_3 = StringInput("Дуга")
contains_3 = String.Contains(string=type, searchFor=string_3, ignoreCase=boolean)
string_4 = StringInput("PolyCurve")
contains_4 = String.Contains(string=type, searchFor=string_4, ignoreCase=boolean)
or_ = Or(bool0=contains, bool1=contains_2, bool2=contains_3, bool3=contains_4)

# group (continued): ВНУТРИ ПОЛЬЗОВАТЕЛЬСКОГО УЗЛА > Проверка объектов NULL и проверка типа
and_ = And(bool0=or_, bool1=not_)
filterByBoolMask = List.FilterByBoolMask(list=flatten, mask=and_)

# group: ВНУТРИ ПОЛЬЗОВАТЕЛЬСКОГО УЗЛА > Входные данные
# Используйте эти элементы управления, чтобы определить, что означает «допустимый».
# minLength — это минимальный порог длины кривой.
# Задайте для requireClosed значение true, если кривые должны быть замкнуты (контуры)
number_5 = DoubleInput(5)
boolean_2 = BoolSelector(false)

# group: ВНУТРИ ПОЛЬЗОВАТЕЛЬСКОГО УЗЛА > Проверка геометрии (длина и замыкание)
# Применение правил для кривых:
# длина должна быть ≥ minLength
# если requireClosed имеет значение true, кривая должна быть замкнутой
length = Curve.Length(curve=filterByBoolMask.in)
# note: Кривые, которые короче MinLength, являются недопустимыми.
ge = length >= number_5
isClosed = Curve.IsClosed(curve=filterByBoolMask.in)
boolean_3 = BoolSelector(true)
if_ = RefactoredIf(test=boolean_2, true=isClosed, false=boolean_3)
and_2 = And(bool0=ge, bool1=if_)

# group: ВНУТРИ ПОЛЬЗОВАТЕЛЬСКОГО УЗЛА > Разделить допустимые и недопустимые кривые
# Использование последней логической маски для разделения кривых на допустимые и недопустимые.
filterByBoolMask_2 = List.FilterByBoolMask(list=filterByBoolMask.in, mask=and_2)

# group: ВНУТРИ ПОЛЬЗОВАТЕЛЬСКОГО УЗЛА > Выходные данные
# validCurves: кривые, прошедшие проверку
# invalidCurves: кривые, которые не прошли проверку
# maskValid: логическая маска для фильтрации в другом месте
code_block = CodeBlock(maskValid=and_2)
# ---------- code_block.designscript (4 lines) ----------
// Boolean mask of validation results
 // true  = valid curve
 // false = invalid curve
 maskValid : bool[]..[];
# ----------------------------------------
code_block_2 = CodeBlock(invalidCurves=filterByBoolMask_2.out)
# ---------- code_block_2.designscript (3 lines) ----------
// Curves that failed validation
 // These should not be used for modelling
 invalidCurves : var[]..[];
# ----------------------------------------
code_block_3 = CodeBlock(validCurves=filterByBoolMask_2.in)
# ---------- code_block_3.designscript (3 lines) ----------
// Curves that passed all validation checks
 // These are safe to use for modelling and automation
 validCurves : var[]..[];
# ----------------------------------------

# group: Входные данные
# Используйте эти элементы управления, чтобы определить, что означает «допустимый».
# Кривые могут представлять собой список линий, дуг, объектов PolyCurve или смешанных типов кривых.
# Используйте FlattenDepth для управления обработкой вложенных списков
number_6 = DoubleInput(5)
boolean_4 = BoolSelector(false)
number_7 = DoubleInput(5)
number_8 = DoubleInput(10)
number_9 = DoubleInput(15)
byCoordinates_4 = Point.ByCoordinates(x=number_7, y=number_8, z=number_9)
byCoordinates_5 = Point.ByCoordinates(x=number_9, y=number_7, z=number_8)
byCoordinates_6 = Point.ByCoordinates(x=number_8, y=number_9, z=number_7)
list_create_2 = List.Create(item0=byCoordinates_4, item1=byCoordinates_5, item2=byCoordinates_6)
byPoints_2 = NurbsCurve.ByPoints(points=list_create_2)
number_10 = DoubleInput(1)

# group: ПОЛЬЗОВАТЕЛЬСКИЙ УЗЕЛ
# Дважды щелкните узел, чтобы развернуть его и открыть файл DYF.
# note: Эта логика сжата в виде пользовательского узла, чтобы сделать проверку кривых простой, многократно используемой и согласованной в различных графах Dynamo. Вместо того, чтобы каждый раз заново создавать одни и те же шаги проверки, правила содержатся в одном четком инструменте, который можно использовать повторно, обновлять и легко распространять. Это сокращает количество ошибок, обеспечивает аккуратность и удобочитаемость графов
curve_Validate = Custom[Curve_Validate](minLength=number_6, requireClosed=boolean_4, curveLikeGeometry=byPoints_2, flattenDepth=number_10)  # Проверка геометрии кривой путем проверки значений NULL, типа, допуска длины и необязательного замыкания. Возврат корректных/недопустимых кривых, логической маски и причин ошибки.

# group: Выходные данные
# Отображение допустимых и недопустимых кривых и маски проверки.
watch = Watch(curve_Validate.invalidCurves)
watch_2 = Watch(curve_Validate.validCurves)
watch_3 = Watch(curve_Validate.maskValid)
