# Dynamo graph Template_02_DynamoWorkflowCustomNode.dyn (Dynamo 3.0.3.7597)
# author: Dynamo
# This document will help you get familiarised with the  creation of Custom node.

# group: Graph Information
# metadata, colour code legend, naming rules
# note: DYNAMO PROJECT
# Template_02_DynamoWorkflowCustomNode
# note: DYNAMO VERSION
# 4.1.0
# note: HOST APPLICATION VERSION
# N/A
# note: ASSOCIATED FILE(S)
# CurveValidate.dyf
# note: REQUIRED DYNAMO PACKAGES
# N/A
# note: AUTHOR(S) / CREATION DATE
# Archilizer for Dynamo Team / Feb. 4 2026
# note: ADDITIONAL COMMENTS
# Custom nodes are typically found in the Add-ons section of the Library.
# This custom node is located under:
# Add-ons → Standards → Curve → Curve_Validate
# If it does not appear:
# Check that the .dyf file is in your custom nodes folder
# Go to:
# Packages → Package Manager → Package Settings → Package/Lirary Search Paths
# Verify the folder path is listed or add a new path
# Restart Dynamo after adding new custom nodes
# note: DESCRIPTION
# This document will help you get familiarized with the  creation of Custom node.
# To keep Dynamo scripts neat and readable, we recommend following a clear
# structure when creating graphs.
# Read more on the Dynamo Primer page about Creating a Custom Node:
# https://primer2.dynamobim.org/6_custom_nodes_and_packages/6-1_custom-nodes/2-creating

# group: INSIDE YOUR CUSTOM NODE
# note: This script checks and filters curve geometry using simple rules. It takes input curves such as lines, arcs etc, and verifies that each object exists, is a valid curve, meets an optional open or closed condition and is longer than a chosen minimum length. The node then outputs valid curves, invalid curves and a boolean validation mask showing which curves passed or failed the checks, making it easier to clean geometry, avoid errors in later steps and prepare data for further processing in Dynamo.

# group: Просмотр
# DEBUG AND CHECK OUTPUTS, USED TO VERIFY RESULTS WITHOUT AFFECTING THE MAIN OUTPUTS
# note: USE : Human-readable checks so you can verify the graph is doing what you expect, without changing results such as watch nodes, List.Count, summary strings, “PASS/FAIL” flags, error lists, preview geometry (Watch3D) and sample outputs.

# group: Аннотации
# note: USE:
# FOR COMMENTS AND SCRIPT INFO.

# group: Выходные данные
# FINAL RESULTS PRODUCED BY THE GRAPH, READY FOR EXPORT OR DOWNSTREAM USE
# note: USE: Final results intended to be used downstream (exported, plugged into another graph) such as final lists, formatted strings, calculated values, dictionaries/tables and  export-ready data.

# group: Входные данные
# USER-CONTROLLED VALUES THAT DEFINE THE TARGET DATA AND SETTINGS BEFORE ANY PROCESSING OCCURS
# note: USE: All user-controlled values that define what the graph will process and how it should behave.
# such as : number sliders, strings, file paths, boolean toggles, dropdowns and initial lists.

# group: Действия
# CORE OPERATIONS THAT PROCESS THE INPUTS
# note: USE: The main processing pipeline that transforms inputs into results. This is where the “work” happens such as list cleaning, mapping, filtering, string logic, geometry operations, formatting and conversions.

# group: INSIDE YOUR CUSTOM NODE > Входные данные
# Use these controls to define what “valid” means.
# curves can be a list of Lines, Arcs, PolyCurves, or mixed curve types.
# Use flattenDepth to control how nested lists are handled.
number = DoubleInput(5)
number_2 = DoubleInput(10)
number_3 = DoubleInput(15)
byCoordinates = Point.ByCoordinates(x=number, y=number_2, z=number_3)
byCoordinates_2 = Point.ByCoordinates(x=number_3, y=number, z=number_2)
byCoordinates_3 = Point.ByCoordinates(x=number_2, y=number_3, z=number)
list_create = List.Create(item0=byCoordinates, item1=byCoordinates_2, item2=byCoordinates_3)
byPoints = NurbsCurve.ByPoints(points=list_create)
number_4 = DoubleInput(1)

# group: INSIDE YOUR CUSTOM NODE > Null And Type Validation
# Filters out nulls and non-curve objects before running curve geometry checks.
# This prevents warnings and makes the node safer for mixed inputs.
flatten = List.Flatten(list=byPoints, amount=number_4)
type = Object.Type(object=flatten)
isNull = Object.IsNull(object=flatten)
not_ = Not(x=isNull)

# group: INSIDE YOUR CUSTOM NODE > Type Of Geometry To Consider
# Curve like geometry
string = StringInput("Отрезок")
boolean = BoolSelector(true)
contains = String.Contains(string=type, searchFor=string, ignoreCase=boolean)
string_2 = StringInput("Кривая")
contains_2 = String.Contains(string=type, searchFor=string_2, ignoreCase=boolean)
string_3 = StringInput("Дуга")
contains_3 = String.Contains(string=type, searchFor=string_3, ignoreCase=boolean)
string_4 = StringInput("PolyCurve")
contains_4 = String.Contains(string=type, searchFor=string_4, ignoreCase=boolean)
или = Or(bool0=contains, bool1=contains_2, bool2=contains_3, bool3=contains_4)

# group (continued): INSIDE YOUR CUSTOM NODE > Null And Type Validation
И = And(bool0=или, bool1=not_)
filterByBoolMask = List.FilterByBoolMask(list=flatten, mask=И)

# group: INSIDE YOUR CUSTOM NODE > Входные данные
# Use these controls to define what “valid” means.
# minLength is a minimum curve length threshold.
# Set requireClosed to true if curves must be closed (loops)
number_5 = DoubleInput(5)
boolean_2 = BoolSelector(false)

# group: INSIDE YOUR CUSTOM NODE > Geometry Checks (Length And Closure)
# Applies curve rules:
# length must be ≥ minLength
# if requireClosed is true, curve must be closed
length = Curve.Length(curve=filterByBoolMask.in)
# note: Curves Shorter Than MinLength Are Invalid.
ge = length >= number_5
isClosed = Curve.IsClosed(curve=filterByBoolMask.in)
boolean_3 = BoolSelector(true)
if_ = RefactoredIf(test=boolean_2, true=isClosed, false=boolean_3)
И_2 = And(bool0=ge, bool1=if_)

# group: INSIDE YOUR CUSTOM NODE > Split Valid And Invalid Curves
# Uses the final boolean mask to separate curves into valid and invalid lists.
filterByBoolMask_2 = List.FilterByBoolMask(list=filterByBoolMask.in, mask=И_2)

# group: INSIDE YOUR CUSTOM NODE > Выходные данные
# validCurves: curves that passed validation
# invalidCurves: curves that failed validation
# maskValid: boolean mask for filtering elsewhere
code_block = CodeBlock(maskValid=И_2)
# ---------- code_block.designscript (4 lines) ----------
// Boolean mask of validation results
 // true  = valid curve
 // false = invalid curve
 maskValid : bool[]..[];
# ----------------------------------------
code_block_2 = CodeBlock(invalidCurves=filterByBoolMask_2.out)
# ---------- code_block_2.designscript (3 lines) ----------
// Curves that failed validation
 // These should not be used for modelling
 invalidCurves : var[]..[];
# ----------------------------------------
code_block_3 = CodeBlock(validCurves=filterByBoolMask_2.in)
# ---------- code_block_3.designscript (3 lines) ----------
// Curves that passed all validation checks
 // These are safe to use for modelling and automation
 validCurves : var[]..[];
# ----------------------------------------

# group: Входные данные
# Use these controls to define what “valid” means.
# curves can be a list of Lines, Arcs, PolyCurves, or mixed curve types.
# Use flattenDepth to control how nested lists are handled
number_6 = DoubleInput(5)
boolean_4 = BoolSelector(false)
number_7 = DoubleInput(5)
number_8 = DoubleInput(10)
number_9 = DoubleInput(15)
byCoordinates_4 = Point.ByCoordinates(x=number_7, y=number_8, z=number_9)
byCoordinates_5 = Point.ByCoordinates(x=number_9, y=number_7, z=number_8)
byCoordinates_6 = Point.ByCoordinates(x=number_8, y=number_9, z=number_7)
list_create_2 = List.Create(item0=byCoordinates_4, item1=byCoordinates_5, item2=byCoordinates_6)
byPoints_2 = NurbsCurve.ByPoints(points=list_create_2)
number_10 = DoubleInput(1)

# group: CUSTOM NODE
# Double click on the node to expand it and open the dyf file.
# note: This logic is compressed as a custom node to make curve checking simple, reusable and consistent across different Dynamo graphs. Instead of rebuilding the same validation steps every time, the rules are contained in one clear tool that can be reused, updated and shared easily. This reduces errors, keeps graphs clean and readable
curve_Validate = Custom[Curve_Validate](minLength=number_6, requireClosed=boolean_4, curveLikeGeometry=byPoints_2, flattenDepth=number_10)  # Validates curve geometry by checking nulls, type, length tolerance, and optional closure. Returns valid/invalid curves, boolean mask, and failure reasons.

# group: Выходные данные
# Shows valid curves, invalid curves and the validation mask.
watch = Watch(curve_Validate.invalidCurves)
watch_2 = Watch(curve_Validate.validCurves)
watch_3 = Watch(curve_Validate.maskValid)
