# Dynamo graph Create a Graph.dyn "创建图表" (Dynamo 4.0.0.3076)
# author: Dynamo
# 本文档将帮助您熟悉标准化工作流和以下重要步骤。

# group: 如何创建 DYNAMO 图形 > 样例
# note: 名称生成器

# group: 组命名标准 输入 → 操作 → 输出 → 审核 > 输入
# 用户控制的值，用于在进行任何处理之前定义目标数据和设置
# note: 用途: 所有用户控制的值，用于定义图表将处理的内容及其应有行为方式。
# 例如数字滑块、字符串、文件路径、布尔切换、下拉列表、初始列表。

# group: 组命名标准 输入 → 操作 → 输出 → 审核 > 操作
# 处理输入的核心操作
# note: 用途: 将输入转换为结果的主要处理工作流程。这是“工作”发生的地方，例如列表清理、映射、过滤、字符串逻辑、几何图形操作、格式化、转换。

# group: 组命名标准 输入 → 操作 → 输出 → 审核 > 输出
# 图形生成的最终结果，可供导出或下游使用
# note: 用途: 旨在用于下游(导出、插入其他图形)的最终结果，例如最终列表、格式化字符串、计算值、词典/表、可导出的数据

# group: 组命名标准 输入 → 操作 → 输出 → 审核 > 审核
# 调试和检查输出 - 用于在不影响主输出的情况下验证结果
# note: 用途: 易于阅读的检查，以便您可以验证图表是否按预期执行，而无需更改结果，例如观察节点、List.Count、摘要字符串、“通过/失败”标志、错误列表、预览几何体(Watch3D)、样例输出。

# group: 组命名标准 输入 → 操作 → 输出 → 审核 > 注释
# note: 用途:
# 用于注释和脚本信息

# group: 图形信息
# 元数据，颜色代码图例，命名规则
# note: DYNAMO PROJECT
# 创建图表
# note: DYNAMO VERSION
# 4.2.0
# note: 主机应用程序版本
# 不适用
# note: 关联的文件
# 不适用
# note: 所需的 DYNAMO 软件包
# 不适用
# note: 作者/创作日期
# 适用于 Dynamo Team 的 Archilizer / 2026 年 2 月 4 日
# note: 其他注释
# 不适用
# note: 描述
# 本文档将帮助您熟悉标准化工作流和以下重要步骤

# group: 如何创建 DYNAMO 图形 > 图形信息
# 元数据，颜色代码图例，命名规则
# note: DYNAMO 项目
# 请参见图表文件命名标准
# note: DYNAMO 版本
# note: 主机应用程序版本
# note: 关联的文件
# note: 所需的 DYNAMO 软件包
# note: 作者/创作日期
# note: 其他注释
# note: 描述
# 图表描述应声明
# 图形有什么作用，它使用什么数据，
# 它应用什么规则，它输出什么，
# 它的运行位置和方式(主机应用 + 版本)以及任何关键限制

# group: 如何创建 DYNAMO 图形 > Dynamo 播放器 输入 → 操作 → 输出
# Dynamo 播放器允许运行 Dynamo 图形，而无需打开 Dynamo 界面。
# 用户仅与预定义输入交互并运行脚本
# note: 在输入节点上单击鼠标右键，然后选择“为输入”
您的输入 = StringInput("Dynamo 播放器")  # graph input
您的操作 = String.ToUpper(string=您的输入)
# note: 在输入节点上单击鼠标右键，然后选择“为输出”
您的输出 = Watch(您的操作)  # graph output

# group: 如何创建 DYNAMO 图形 > 节点命名标准
# note: 请勿更改整个节点名称，而是在末尾使用括号。
string = StringInput("")
# note: 做
string_input_1 = StringInput("")
# note: 不做
# note: 请根据您的办公标准更新这些规则
input_1 = StringInput("")
typical_do_do_not_rules = CodeBlock()
# ---------- typical_do_do_not_rules.designscript (12 lines) ----------
/*
Do:
Rename key nodes only (inputs, rules, outputs, decision logic)
Use notes to add context to your script
Use capitalization consistently (e.g. Title Case or camelCase, not mixed)
*/

/*Do Not:
Rename every node in the graph
Leave important nodes with default names if they affect logic
Use vague names like "Data", "Stuff", "Fix", "Test"
*/;
# ----------------------------------------

# group: 如何创建 DYNAMO 图形 > 图形文件命名标准
# 为了按名称了解图形的用途或预期用途，我们建议遵循类似于 BIM 执行计划约定的命名模式:
string_2 = StringInput("-")
组织 = CodeBlock { "AUT"; }
function_fields = CodeBlock { BLD  = "BLD"; STR  = "STR"; MEP  = "MEP"; INFR = "INFR"; }
说明 = CodeBlock { "Logical_description"; }
dynamo_version = CodeBlock { "D303"; }
script_version_only_for_backup = CodeBlock { "V2"; }  # "Script-Version (only for backup files)"
部件顺序 = String.Join(separator=string_2, string0=组织, string1=function_fields.BLD, string2=说明, string3=dynamo_version, string4=script_version_only_for_backup)
名称示例 = Watch(部件顺序)
# note: 建议的命名结构
命名结构 = CodeBlock()
# ---------- 命名结构.designscript (3 lines) ----------
["Organisation  | Function fields | Description         | Dynamo-Version | Script-Version",
"AUT            |BLD              | Logical_description | D303           | V3"
];
# ----------------------------------------
# note: 不编辑:
# note: 函数域描述脚本的主要工作区域/域
function_fields_2 = CodeBlock()
# ---------- function_fields_2.designscript (4 lines) ----------
BLD  = "BLD  — Building design";
STR  = "STR  — Structural design";
MEP  = "MEP  — Mechanical / Electrical / Plumbing";
INFR = "INFR — Infrastructure";
# ----------------------------------------

# group: 如何创建 DYNAMO 图形
# 结构、命名和最佳实践的视觉指南
# note: 仅在关键检查点使用观察节点
# 冻结非活动脚本
# note: 在运行图形之前:
# 检查是否已设置输入
# 审核预览/检查
# 在使用 Dynamo 播放器之前手动运行一次
# 成功运行后保存文件
# note: 本文档将帮助您熟悉标准化工作流和以下重要步骤
# note: 背景/背板
信息 = CodeBlock()
# ---------- 信息.designscript (5 lines) ----------
"To keep Dynamo graphs neat and readable, we recommend following a clear
structure.

For more information, read the Dynamo Primer page on best-practice graph strategies:
https://primer2.dynamobim.org/9_best_practices/1-graph-strategies";
# ----------------------------------------
