# Dynamo graph Import & Export Workflow.dyn "输入和输出工作流" (Dynamo 4.0.0.3076)
# author: Dynamo
# 本文档将帮助您熟悉导入和导出 excel 和 csv 文件的不同方法。

# group: 图形信息
# 元数据，颜色代码图例，命名规则
# note: DYNAMO PROJECT
# 输入和输出工作流
# note: DYNAMO VERSION
# 4.2.0
# note: 主机应用程序版本
# 不适用
# note: 关联的文件
# 不适用
# note: 所需的 DYNAMO 软件包
# 不适用
# note: 作者/创作日期
# 适用于 Dynamo Team 的 Archilizer / 2026 年 2 月 4 日
# note: 其他注释
# 不适用
# note: 描述
# 本文档将帮助您熟悉导入和导出 excel 和 csv 文件的不同方法。
# 一次只能使用一种输入法。冻结未使用的脚本。

# group: 审核
# 调试和检查输出 - 用于在不影响主输出的情况下验证结果
# note: 用途: 易于阅读的检查，以便您可以验证图表是否执行您期望的操作而无需更改结果，例如 watch 节点、List.Count、摘要字符串、“通过/失败”标志、错误列表、预览几何图形 (Watch3D) 和示例输出。

# group: 注释
# note: 用途:
# 用于评论和脚本信息。

# group: 输出
# 图形生成的最终结果，可供导出或下游使用
# note: 用途: 旨在用于下游(导出、插入其他图形)的最终结果，例如最终列表、格式化字符串、计算值、词典/表和可导出数据。

# group: 输入
# 用户控制的值，用于在进行任何处理之前定义目标数据和设置
# note: 用途: 所有用户控制的值，用于定义图表将处理的内容及其应有的行为方式。
# 例如: 数字滑块、字符串、文件路径、布尔切换、下拉列表和初始列表。

# group: 操作
# 处理输入的核心操作
# note: 用途: 将输入转换为结果的主要处理工作流。这是“工作”发生的地方，例如列表清理、映射、过滤、字符串逻辑、几何图形操作、格式设置和转换。

# group: CSV 导入/导出
# 此脚本用于导入 CSV 数据、根据定义的命名规则对其进行分析和重新结构化，以及分离有效和无效条目以供查看和更正。在此工作流中，使用基于规则的验证逻辑处理名称列表，根据命名约定进行排序，并分类为有效组和无效组。导出有效名称以供下游使用，例如协调和报告
# note: 提示: 在输入之后添加一个 Watch 节点以验证文件的导入方式

# group: Excel 输入/输出 > Excel 导入
# 将数据从 Excel （.xlsx） 文件导入 Dynamo，将电子表格的行和列转换为结构化列表以进行处理、验证和操作。常见用途包括下游工作流的明细表、参数和数量
# note: Click Browse and select your own Excel (.xlsx) file before running this graph
file_path = Filename("未选择文件。")
string = StringInput("sheet1")
# note: 读取数字时设置为 false。
# 读取文本时设置为 true。
boolean = BoolSelector(false)
openXMLImportExcel = Data.OpenXMLImportExcel(filePath=file_path, sheetName=string, readAsString=boolean)
# note: 使用 “List.Transpose” 读取列表的列。
# 不要转置以读取列表的行。
transpose = List.Transpose()  # unwired: lists

# group: Excel 输入/输出 > Excel 的数据结构
# 删除空条目并删除标头
# note: 检索标头
deconstruct = List.Deconstruct(list=openXMLImportExcel)
布尔 = BoolSelector(false)
clean = List.Clean(list=deconstruct.其余, preserveIndices=布尔)

# group: Excel 输入/输出 > 按相似性分组
# Excel 的数据操作示例
transpose_2 = List.Transpose(lists=clean)
code_block_列索引 = CodeBlock { 1; }
# note: 仅用于提取单个关键列
getItemAtIndex = List.GetItemAtIndex(list=transpose_2, index=code_block_列索引)
number = DoubleInput(0)
boolean_2 = BoolSelector(false)
groupBySimilarity = List.GroupBySimilarity(list=getItemAtIndex, tolerance=number, considerAdjacency=boolean_2)

# group: Excel 输入/输出 > 楼层列提取
# 确认列索引
watch = Watch(getItemAtIndex)

# group: CSV 导入/导出 > CSV 导入
# 将 CSV 数据导入 Dynamo 并针对基于规则的验证、排序和分类工作流构建数据
# note: Click Browse and select your own CSV (.csv) file before running this graph
file_path_2 = Filename("未选择文件。")
boolean_3 = BoolSelector(true)
# note: 如果要读取列，则转置列表。
# 如果要读取行，请不要转置列表
importCSV = Data.ImportCSV(filePath=file_path_2, transpose=boolean_3)

# group: CSV 导入/导出 > CSV 的数据结构
# 数据结构化: 合并和清理输入，以便下游规则始终收到一致的字符串列表(无空值、无嵌套列表、格式清晰)。
deconstruct_2 = List.Deconstruct(list=importCSV)
transpose_3 = List.Transpose(lists=deconstruct_2.rest)
code_block_要读取的列的索引 = CodeBlock { 0; }
getItemAtIndex_2 = List.GetItemAtIndex(list=transpose_3, index=code_block_要读取的列的索引)
boolean_4 = BoolSelector(false)
clean_2 = List.Clean(list=getItemAtIndex_2, preserveIndices=boolean_4)

# group: CSV 导入/导出 > 审核
# 审核标题的提取
watch_标题 = Watch(deconstruct_2.first)

# group: CSV 导入/导出 > 关键字定义
# 用户可编辑的设置，用于定义检查使用的 Office 命名规则(大写、关键字和必需的分隔符)。更新这些内容以匹配项目或 Office 标准
# note: 编辑此列表以匹配 Office 命名约定
toUpper = String.ToUpper(string=clean_2)
code_block = CodeBlock { "-"; }
code_block_2 = CodeBlock()
# ---------- code_block_2.designscript (2 lines) ----------
// one output list
["GA","DET","STRUCT"];
# ----------------------------------------
code_block_3 = CodeBlock { 0; }
code_block_4 = CodeBlock { 1; }
code_block_5 = CodeBlock { 2; }

# group: CSV 导入/导出 > 规则检查(大写 + 分隔符)
# 按名称生成布尔规则输出。检查每个名称是否为大写，是否包含所需的分隔符字符串
eq = clean_2 == toUpper
contains = String.Contains(string=clean_2, searchFor=code_block)

# group: CSV 导入/导出 > 关键字检查(包含任何关键字)
# 检查每个名称是否至少包含一个已批准的关键字。输出布尔列表，其中每个项目都对应于匹配的名称。
getItemAtIndex_3 = List.GetItemAtIndex(list=code_block_2, index=code_block_3)
contains_2 = String.Contains(string=clean_2, searchFor=getItemAtIndex_3)
getItemAtIndex_4 = List.GetItemAtIndex(list=code_block_2, index=code_block_4)
contains_3 = String.Contains(string=clean_2, searchFor=getItemAtIndex_4)
or_ = Or(bool0=contains_2, bool1=contains_3)
getItemAtIndex_5 = List.GetItemAtIndex(list=code_block_2, index=code_block_5)
contains_4 = String.Contains(string=clean_2, searchFor=getItemAtIndex_5)
or_2 = Or(bool0=or_, bool1=contains_4)

# group: CSV 导入/导出 > 将检查组合为最终掩码
# 使用 AND 逻辑将所有规则输出组合成一个最终布尔掩码。此掩码定义每个名称是有效还是无效。
and_ = And(bool0=eq, bool1=contains)
and_2 = And(bool0=and_, bool1=or_2)

# group: CSV 导入/导出 > 有效名称与无效名称
# 输出: 根据最终掩码将输入名称列表拆分为有效结果和无效结果
filterByBoolMask = List.FilterByBoolMask(list=clean_2, mask=and_2)

# group: CSV 导入/导出 > 调试和摘要
# 进行可视检查以确认输入、规则和输出
无效名称 = Watch(filterByBoolMask.in)
无效名称_2 = Watch(filterByBoolMask.out)

# group: CSV 导入/导出 > 导出为 CSV
# 导出验证的名称集
file_path_3 = Filename("未选择文件。")
exportCSV = Data.ExportCSV(filePath=file_path_3, data=filterByBoolMask.in)

# group: Excel 输入/输出 > 审核/分组的楼层
# 相似度聚类后分组的下限值预览。用于验证正确的分组和命名一致性
watch_2 = Watch(groupBySimilarity.groupedValues)

# group: Excel 输入/输出 > 审核/分组的楼层
# 相似度聚类后分组的下限值预览。用于验证正确的分组和命名一致性
watch_3 = Watch(groupBySimilarity.groupedIndices)

# group: Excel 输入/输出
# 此脚本从 Excel 导入结构化数据，根据定义的规则对其进行处理和重新组织，然后导出变换后的结果以供外部使用。在此工作流中，将导入、分析房间列表并按位置重新排列，从而基于空间条件将房间分组为结构化列表。然后导出处理后的数据，以用于协调和报告。
integer_slider = IntegerSlider(1, range=0..2 step 1)

# group: Excel 输入/输出 > 导出前插入标题(可选)
# 在导出数据的开头插入标题行。
# note: 使用 groupedIndices 拉取原始行
getItemAtIndex_6 = List.GetItemAtIndex(list=clean, index=groupBySimilarity.groupedIndices)
flatten = List.Flatten(list=getItemAtIndex_6, amount=integer_slider)
integer_slider_2 = IntegerSlider(0, range=0..2 step 1)
# note: 导出前在索引 0 处插入标头
insert = List.Insert(list=flatten, element=deconstruct.first, index=integer_slider_2)

# group: Excel 输入/输出 > 审核/分组的行结构
# 在展平和导出之前检查嵌套行结构
watch_4 = Watch(insert)

# group: Excel 输入/输出 > 导出到 Excel
# 将结构化 Dynamo 数据导出到 Excel (.xlsx)。支持输出以供外部审核和与其他工具集成
# note: 导出文件名必须以 .xlsx 结尾
# 如果已存在同名文件且“覆盖”设置为 false，则导出将失败，并且不会创建新文件。
# 要替换现有文件，必须启用“覆盖”。
文件路径 = Filename("未选择文件。")
string_2 = StringInput("“导出图纸”")
integer_slider_3 = IntegerSlider(0, range=0..100 step 1)
布尔_2 = BoolSelector(true)
openXMLExportExcel = Data.OpenXMLExportExcel(filePath=文件路径, sheetName=string_2, data=insert, startRow=integer_slider_3, startColumn=integer_slider_3, writeAsString=布尔_2)

# group: 几何图形导入/导出 > 几何图形导入
# 将几何图形从 SAT 文件导入 Dynamo，并将其转换为可编辑的曲线、曲面和实体以用于变换工作流
# note: Click Browse and select your own SAT (.sat) file before running this graph
file_path_4 = Filename("未选择文件。")
file_from_path = FileObject(path=file_path_4)
单位 = Units("Meters")
# note: 将文件作为 Dynamo 实体/曲面/曲线输入
importFromSATWithUnits = Geometry.ImportFromSATWithUnits(file_filePath=file_from_path, dynamoUnit=单位)
watch_3d_导入几何图形的预览 = Watch3D(importFromSATWithUnits)

# group: 几何图形导入/导出 > 调试/学习组
# 显示 Dynamo 认为每个项目是什么(实体、曲面、曲线等)。
# 如果导入行为异常，则很有用。
type = Object.Type(object=importFromSATWithUnits)
watch_5 = Watch(type)

# group: 几何图形导入/导出 > 转换
# 按统一系数缩放导入的几何图形
XY = Plane.XY()
code_block_6 = CodeBlock { 5; }
scale = Geometry.Scale(geometry=importFromSATWithUnits, plane=XY, xamount=code_block_6, yamount=code_block_6, zamount=code_block_6)

# group: 几何图形导入/导出 > 导出为 SAT
# 将更新的几何图形导出为 SAT 文件。SAT 文件可以导入到 Autocad、Revit 等。
file_path_5 = Filename("未选择文件。")
exportToSAT = Geometry.ExportToSAT(geometry=scale, filePath=file_path_5)
watch_3d_预览缩放的几何图形 = Watch3D(scale)
