# Dynamo graph Make a Custom Node.dyn "生成自定义节点" (Dynamo 3.0.3.7597)
# author: Dynamo
# 本文档将帮助您熟悉如何创建自定义节点。

# group: 图形信息
# 元数据，颜色代码图例，命名规则
# note: DYNAMO PROJECT
# 生成自定义节点
# note: DYNAMO 版本
# 4.1.0
# note: 主机应用程序版本
# 不适用
# note: ASSOCIATED FILE(S)
# Curve_Validate.dyf
# note: 所需的 DYNAMO 软件包
# 不适用
# note: 作者/创作日期
# 适用于 Dynamo Team 的 Archilizer / 2026 年 2 月 4 日
# note: ADDITIONAL COMMENTS
# Custom nodes are typically found in the Add-ons section of the Library.
# This custom node is located under:
# Add-ons → Templates → Curve → Curve_Validate
# If it does not appear:
# Check that the .dyf file is in your custom nodes folder
# Go to:
# Packages → Package Manager → Package Settings → Package/Library Search Paths
# Verify the folder path is listed or add a new path
# Restart Dynamo after adding new custom nodes
# note: 描述
# 本文档将帮助您熟悉如何创建自定义节点。
# 要使 Dynamo 脚本保持整洁可读，我们建议遵循清晰的
# 结构。
# 在 Dynamo Primer 页面上阅读有关创建自定义节点的详细信息:
# https://primer2.dynamobim.org/zh-cn/6_custom_nodes_and_packages/6-1_custom-nodes/2-creating

# group: 在自定义节点内
# note: 此脚本使用简单的规则检查和过滤曲线几何图形。它接受输入曲线(例如线、圆弧等)，并验证每个对象是否存在、是否为有效曲线、是否满足可选的开放或闭合条件以及是否长于选定的最小长度。然后，该节点将输出有效曲线、无效曲线和布尔验证掩码，以指示哪些曲线通过检查、哪些未通过检查，从而更轻松地清理几何图形、避免后续步骤中的错误，以及准备数据以便在 Dynamo 中进一步处理。

# group: 审核
# 调试和检查输出 - 用于在不影响主输出的情况下验证结果
# note: 用途: 易于阅读的检查，以便您可以验证图表是否执行您期望的操作而无需更改结果，例如 watch 节点、List.Count、摘要字符串、“通过/失败”标志、错误列表、预览几何图形 (Watch3D) 和示例输出。

# group: 注释
# note: 用途:
# 用于评论和脚本信息。

# group: 输出
# 图形生成的最终结果，可供导出或下游使用
# note: 用途: 旨在用于下游(导出、插入其他图形)的最终结果，例如最终列表、格式化字符串、计算值、词典/表和可导出数据。

# group: 输入
# 用户控制的值，用于在进行任何处理之前定义目标数据和设置
# note: 用途: 所有用户控制的值，用于定义图表将处理的内容及其应有的行为方式。
# 例如: 数字滑块、字符串、文件路径、布尔切换、下拉列表和初始列表。

# group: 操作
# 处理输入的核心操作
# note: 用途: 将输入转换为结果的主要处理工作流。这是“工作”发生的地方，例如列表清理、映射、过滤、字符串逻辑、几何图形操作、格式设置和转换。

# group: 在自定义节点内 > 输入
# 使用这些控件定义“有效”的含义。
# 曲线可以是一系列直线、圆弧、复合线或混合曲线类型。
# 使用 flattenDepth 控制嵌套列表的处理方式。
number = DoubleInput(5)
number_2 = DoubleInput(10)
number_3 = DoubleInput(15)
byCoordinates = Point.ByCoordinates(x=number, y=number_2, z=number_3)
byCoordinates_2 = Point.ByCoordinates(x=number_3, y=number, z=number_2)
byCoordinates_3 = Point.ByCoordinates(x=number_2, y=number_3, z=number)
list_create = List.Create(item0=byCoordinates, item1=byCoordinates_2, item2=byCoordinates_3)
byPoints = NurbsCurve.ByPoints(点=list_create)
number_4 = DoubleInput(1)

# group: 在自定义节点内 > Null 和类型验证
# 在运行曲线几何图形检查之前，过滤出 Null 对象和非曲线对象。
# 这可以防止出现警告，并使节点对混合输入更安全。
flatten = List.Flatten(list=byPoints, amount=number_4)
type = Object.Type(对象=flatten)
isNull = Object.IsNull(对象=flatten)
not_ = Not(x=isNull)

# group: 在自定义节点内 > 要考虑的几何图形类型
# 曲线状几何图形
string = StringInput("直线")
布尔 = BoolSelector(true)
contains = String.Contains(string=type, searchFor=string, ignoreCase=布尔)
string_2 = StringInput("曲线")
contains_2 = String.Contains(string=type, searchFor=string_2, ignoreCase=布尔)
string_3 = StringInput("圆弧")
contains_3 = String.Contains(string=type, searchFor=string_3, ignoreCase=布尔)
string_4 = StringInput("PolyCurve")
contains_4 = String.Contains(string=type, searchFor=string_4, ignoreCase=布尔)
or_ = Or(bool0=contains, bool1=contains_2, bool2=contains_3, bool3=contains_4)

# group (continued): 在自定义节点内 > Null 和类型验证
and_ = And(bool0=or_, bool1=not_)
filterByBoolMask = List.FilterByBoolMask(list=flatten, 掩码=and_)

# group: 在自定义节点内 > 输入
# 使用这些控件定义“有效”的含义。
# minLength 是最小曲线长度阈值。
# 如果曲线必须闭合(环)，则将 requireClosed 设置为 true
number_5 = DoubleInput(5)
布尔_2 = BoolSelector(false)

# group: 在自定义节点内 > 几何图形检查(长度和闭合)
# 应用曲线规则:
# length 必须 ≥ minLength
# 如果 requireClosed 为 true，则必须闭合曲线
length = Curve.Length(curve=filterByBoolMask.in)
# note: 短于 MinLength 的曲线无效。
ge = length >= number_5
isClosed = Curve.IsClosed(curve=filterByBoolMask.in)
布尔_3 = BoolSelector(true)
if_ = RefactoredIf(测试=布尔_2, true=isClosed, false=布尔_3)
and_2 = And(bool0=ge, bool1=if_)

# group: 在自定义节点内 > 拆分有效曲线和无效曲线
# 使用最终布尔掩码将曲线分隔为有效列表和无效列表。
filterByBoolMask_2 = List.FilterByBoolMask(list=filterByBoolMask.in, 掩码=and_2)

# group: 在自定义节点内 > 输出
# validCurves: 通过验证的曲线
# invalidCurves: 验证失败的曲线
# maskValid: 用于在其他地方过滤的布尔掩码
代码块 = CodeBlock(maskValid=and_2)
# ---------- 代码块.designscript (4 lines) ----------
// Boolean mask of validation results
 // true  = valid curve
 // false = invalid curve
 maskValid : bool[]..[];
# ----------------------------------------
代码块_2 = CodeBlock(invalidCurves=filterByBoolMask_2.out)
# ---------- 代码块_2.designscript (3 lines) ----------
// Curves that failed validation
 // These should not be used for modelling
 invalidCurves : var[]..[];
# ----------------------------------------
代码块_3 = CodeBlock(validCurves=filterByBoolMask_2.in)
# ---------- 代码块_3.designscript (3 lines) ----------
// Curves that passed all validation checks
 // These are safe to use for modelling and automation
 validCurves : var[]..[];
# ----------------------------------------

# group: 输入
# 使用这些控件定义“有效”的含义。
# 曲线可以是一系列直线、圆弧、复合线或混合曲线类型。
# 使用 flattenDepth 控制嵌套列表的处理方式
number_6 = DoubleInput(5)
布尔_4 = BoolSelector(false)
number_7 = DoubleInput(5)
number_8 = DoubleInput(10)
number_9 = DoubleInput(15)
byCoordinates_4 = Point.ByCoordinates(x=number_7, y=number_8, z=number_9)
byCoordinates_5 = Point.ByCoordinates(x=number_9, y=number_7, z=number_8)
byCoordinates_6 = Point.ByCoordinates(x=number_8, y=number_9, z=number_7)
list_create_2 = List.Create(item0=byCoordinates_4, item1=byCoordinates_5, item2=byCoordinates_6)
byPoints_2 = NurbsCurve.ByPoints(点=list_create_2)
number_10 = DoubleInput(1)

# group: 自定义节点
# 双击该节点以将其展开，然后打开 dyf 文件。
# note: 此逻辑被压缩为自定义节点，以使曲线检查在不同的 Dynamo 图形之间变得简单、可重用和一致。规则包含在一个可以轻松重用、更新和共享的清晰工具中，而不是每次都重新构建相同的验证步骤。这减少了错误，并保持图表清晰易读
curve_Validate = Custom[Curve_Validate](minLength=number_6, requireClosed=布尔_4, curveLikeGeometry=byPoints_2, flattenDepth=number_10)  # 通过检查 null 值、类型、长度容差和可选闭合来验证曲线几何图形。返回有效/无效曲线、布尔掩码和失败原因。

# group: 输出
# 显示有效曲线、无效曲线和验证掩码。
watch = Watch(curve_Validate.invalidCurves)
watch_2 = Watch(curve_Validate.validCurves)
watch_3 = Watch(curve_Validate.maskValid)
