# Dynamo graph Create a Graph.dyn "建立圖表" (Dynamo 4.0.0.3076)
# author: Dynamo
# 本文件將協助您熟悉標準工作流程，以及下列重要步驟。

# group: 如何建立 Dynamo 圖表 > 範例
# note: 名稱產生器

# group: 群組命名標準 輸入 → 動作 → 輸出 → 檢閱 > 輸入
# 使用者控制的值，定義在進行任何處理之前的目標資料和設定
# note: 用途: 所有使用者控制的值，用於定義圖表將處理的內容及其運作方式。
# 例如數字滑棒、字串、檔案路徑、布林切換、下拉式清單、初始清單。

# group: 群組命名標準 輸入 → 動作 → 輸出 → 檢閱 > 動作
# 處理輸入的核心作業
# note: 用途: 將輸入轉換為結果的主要處理管線。這是「工作」(例如清單清理、對映、篩選、字串邏輯、幾何圖形運算、格式化、轉換) 進行的地方。

# group: 群組命名標準 輸入 → 動作 → 輸出 → 檢閱 > 輸出
# 圖表產生的最終結果，可匯出或供下游使用
# note: 用途: 預定在下游 (匯出並插入到另一個圖表) 使用的最終結果，例如最終清單、格式化的字串、計算的值、字典/表格、可供匯出的資料

# group: 群組命名標準 輸入 → 動作 → 輸出 → 檢閱 > 檢閱
# 除錯和檢查輸出，用於在不影響主要輸出的情況下驗證結果
# note: 用途: 人類可理解的檢查，方便您在不改變結果的情況下確認圖表是否符合預期，例如 Watch 節點、List.Count、摘要字串、「通過/失敗」旗標、錯誤清單、預覽幾何圖形 (Watch3D)、範例輸出。

# group: 群組命名標準 輸入 → 動作 → 輸出 → 檢閱 > 標註
# note: 用途:
# 用於註解和指令碼資訊

# group: 圖表資訊
# 詮釋資料，顏色編碼圖例，命名規則
# note: Dynamo 專案
# 建立圖表
# note: DYNAMO VERSION
# 4.2.0
# note: 主體應用程式版本
# 不適用
# note: 關聯的檔案
# 不適用
# note: 需要的 Dynamo 套件
# 不適用
# note: 作者/建立日期
# Dynamo 團隊的 Archilizer/2026 年 2 月 4 日
# note: 其他註解
# 不適用
# note: 描述
# 本文件將協助您熟悉標準工作流程，以及下列重要步驟

# group: 如何建立 Dynamo 圖表 > 圖表資訊
# 詮釋資料，顏色編碼圖例，命名規則
# note: Dynamo 專案
# 請參閱「圖表檔案命名標準」
# note: Dynamo 版本
# note: 主體應用程式版本
# note: 關聯的檔案
# note: 需要的 Dynamo 套件
# note: 作者/建立日期
# note: 其他註解
# note: 描述
# 圖表描述應說明
# 圖表的用途、使用的資料、
# 適用的規則、輸出的結果、
# 執行的位置和方式 (主體應用程式 + 版本) 以及任何重要限制

# group: 如何建立 Dynamo 圖表 > Dynamo 播放器 輸入 → 動作 → 輸出
# Dynamo 播放器允許在不開啟 Dynamo 介面的情況下執行 Dynamo 圖表。
# 使用者只會與預先定義的輸入互動並執行指令碼
# note: 在您的輸入節點上按一下右鍵，然後選取「是輸入」
您的輸入 = StringInput("Dynamo 播放器")  # graph input
您的動作 = String.ToUpper(string=您的輸入)
# note: 在您的輸入節點上按一下右鍵，然後選取「是輸出」
您的輸出 = Watch(您的動作)  # graph output

# group: 如何建立 Dynamo 圖表 > 節點命名標準
# note: 不要變更整個節點名稱，而是在結尾使用括弧。
string = StringInput("")
# note: 做
string_input_1 = StringInput("")
# note: 不做
# note: 根據您的辦公室標準更新這些規則
input_1 = StringInput("")
典型的做_不做規則 = CodeBlock()
# ---------- 典型的做_不做規則.designscript (12 lines) ----------
/*
Do:
Rename key nodes only (inputs, rules, outputs, decision logic)
Use notes to add context to your script
Use capitalization consistently (e.g. Title Case or camelCase, not mixed)
*/

/*Do Not:
Rename every node in the graph
Leave important nodes with default names if they affect logic
Use vague names like "Data", "Stuff", "Fix", "Test"
*/;
# ----------------------------------------

# group: 如何建立 Dynamo 圖表 > 圖表檔案命名標準
# 為了透過名稱理解圖表的目的或預定用途，我們建議按照類似於 BIM 執行計畫慣例的命名模式:
string_2 = StringInput("-")
組織 = CodeBlock { "AUT"; }
函數欄位 = CodeBlock { BLD  = "BLD"; STR  = "STR"; MEP  = "MEP"; INFR = "INFR"; }
描述 = CodeBlock { "Logical_description"; }
dynamo_版本 = CodeBlock { "D303"; }
指令碼版本_僅適用於備份檔案 = CodeBlock { "V2"; }
組合順序 = String.Join(separator=string_2, string0=組織, string1=函數欄位.BLD, string2=描述, string3=dynamo_版本, string4=指令碼版本_僅適用於備份檔案)
名稱範例 = Watch(組合順序)
# note: 建議的命名結構
命名結構 = CodeBlock()
# ---------- 命名結構.designscript (3 lines) ----------
["Organisation  | Function fields | Description         | Dynamo-Version | Script-Version",
"AUT            |BLD              | Logical_description | D303           | V3"
];
# ----------------------------------------
# note: 不要編輯 :
# note: 函數欄位描述指令碼主要的工作區域/範圍
函數欄位_2 = CodeBlock()
# ---------- 函數欄位_2.designscript (4 lines) ----------
BLD  = "BLD  — Building design";
STR  = "STR  — Structural design";
MEP  = "MEP  — Mechanical / Electrical / Plumbing";
INFR = "INFR — Infrastructure";
# ----------------------------------------

# group: 如何建立 Dynamo 圖表
# 瞭解結構、命名和最佳實踐的視覺指南
# note: 只在關鍵檢查點使用 Watch 節點
# 凍結非使用中指令碼
# note: 執行圖表之前:
# 檢查是否已設定輸入
# 檢閱預覽/檢查
# 使用 Dynamo 播放器之前請手動執行一次
# 成功執行之後儲存檔案
# note: 本文件將協助您熟悉標準工作流程，以及下列重要步驟
# note: 背景/背板
資訊 = CodeBlock()
# ---------- 資訊.designscript (5 lines) ----------
"To keep Dynamo graphs neat and readable, we recommend following a clear
structure.

For more information, read the Dynamo Primer page on best-practice graph strategies:
https://primer2.dynamobim.org/9_best_practices/1-graph-strategies";
# ----------------------------------------
