# Dynamo graph Import & Export Workflow.dyn "匯入和匯出工作流程" (Dynamo 4.0.0.3076)
# author: Dynamo
# 本文件將協助您熟悉不同匯入和匯出 Excel 和 CSV 檔案的方式。

# group: 關鍵字定義 > 標註
# note: 編輯此清單以符合辦公室命名慣例

# group: 圖表資訊
# 詮釋資料，顏色編碼圖例，命名規則
# note: Dynamo 專案
# 匯入和匯出工作流程
# note: Dynamo 版本
# 4.1.0
# note: 主體應用程式版本
# 不適用
# note: 關聯的檔案
# Excel_Import_Example.xlsx
# CSV_Import_Example.csv
# Geometry_Import_Example.sat
# note: 需要的 Dynamo 套件
# 不適用
# note: 作者/建立日期
# Dynamo 團隊的 Archilizer/2026 年 2 月 4 日
# note: 其他註解
# 不適用
# note: 描述
# 本文件將協助您熟悉不同匯入和匯出 Excel 和 CSV 檔案的方式。
# 一次只能使用一個輸入方法。凍結未使用的指令碼。

# group: 檢閱
# 除錯和檢查輸出，用於在不影響主要輸出的情況下驗證結果
# note: 用途: 人類可理解的檢查，方便您在不改變結果的情況下確認圖表是否符合預期，例如 Watch 節點、List.Count、摘要字串、「通過/失敗」旗標、錯誤清單、預覽幾何圖形 (Watch3D)，以及範例輸出。

# group: 標註
# note: 用途:
# 用於註解和指令碼資訊。

# group: 輸出
# 圖表產生的最終結果，可匯出或供下游使用
# note: 用途: 預定在下游 (匯出並插入到另一個圖表) 使用的最終結果，例如最終清單、格式化的字串、計算的值、字典/表格，以及可供匯出的資料。

# group: 輸入
# 使用者控制的值，定義在進行任何處理之前的目標資料和設定
# note: 用途: 所有使用者控制的值，用於定義圖表將處理的內容及其運作方式。
# 例如數字滑棒、字串、檔案路徑、布林切換、下拉式清單、初始清單。

# group: 動作
# 處理輸入的核心作業
# note: 用途: 將輸入轉換為結果的主要處理管線。這是「工作」(例如清單清理、對映、篩選、字串邏輯、幾何圖形運算、格式化，以及轉換) 進行的地方。

# group: CSV 匯入/匯出
# 此指令碼匯入 CSV 資料，根據定義的命名規則分析和重新架構，並區分有效和無效的項目以供檢閱和更正。在此工作流程中，使用基於規則的驗證邏輯處理名稱清單，根據命名慣例排序，並分類為有效和無效群組，然後將有效名稱匯出供下游使用 (例如協調和報告)
# note: 如果要讀取欄，則轉置清單。
# 如果要讀取列，則不要轉置清單
# note: 秘訣: 在輸入後增加一個 Watch 節點，可確認檔案的匯入方式

# group: Excel 匯入
# 讀取數值時設為 false。
# 讀取文字時設為 true。
boolean = BoolSelector(false)

# group: Excel 匯入
# 將 Excel (.xlsx) 檔案中的資料匯入 Dynamo，將試算表的列和欄轉換為結構化清單進行處理、驗證和操控。常見用途包括明細表、參數和數量供下游工作流程使用
檔案路徑 = Filename("..\..\..\..\..\..\Desktop\Excel_Import_Example.xlsx")
string = StringInput("sheet1")
openXMLImportExcel = Data.OpenXMLImportExcel(filePath=檔案路徑, sheetName=string, readAsString=boolean)
# note: 使用 List.Transpose 讀取清單的欄。
# 不轉置可讀取清單的列。
transpose = List.Transpose()  # unwired: lists

# group: Excel 匯入/匯出 > Excel 的資料結構化
# 移除空值/空項目並移除標題
# note: 擷取標題
deconstruct = List.Deconstruct(list=openXMLImportExcel)
boolean_2 = BoolSelector(false)
clean = List.Clean(list=deconstruct.rest, preserveIndices=boolean_2)

# group: Excel 匯入/匯出 > 依相似性分組
# Excel 資料操控範例
transpose_2 = List.Transpose(lists=clean)
code_block_欄索引 = CodeBlock { 1; }
# note: 僅用於萃取單一鍵值欄
getItemAtIndex = List.GetItemAtIndex(list=transpose_2, index=code_block_欄索引)
number = DoubleInput(0)
boolean_3 = BoolSelector(false)
groupBySimilarity = List.GroupBySimilarity(list=getItemAtIndex, tolerance=number, considerAdjacency=boolean_3)

# group: Excel 匯入/匯出 > 樓板柱萃取
# 確認柱索引
watch = Watch(getItemAtIndex)

# group: CSV 匯入/匯出 > CSV 匯入
# 將 CSV 資料匯入至 Dynamo 並將其結構化，以用於基於規則的驗證、排序和分類工作流程
檔案路徑_2 = Filename("..\Data\CSV_Import_Example.csv")
boolean_4 = BoolSelector(true)
importCSV = Data.ImportCSV(filePath=檔案路徑_2, 轉置=boolean_4)

# group: CSV 匯入/匯出 > CSV 資料結構化
# 資料結構化: 合併並清理輸入，讓下游規則永遠都會收到一致的字串清單 (無空值、無巢狀清單、乾淨的格式)。
deconstruct_2 = List.Deconstruct(list=importCSV)
transpose_3 = List.Transpose(lists=deconstruct_2.rest)
code_block_要讀取的欄索引 = CodeBlock { 0; }
getItemAtIndex_2 = List.GetItemAtIndex(list=transpose_3, index=code_block_要讀取的欄索引)
boolean_5 = BoolSelector(false)
clean_2 = List.Clean(list=getItemAtIndex_2, preserveIndices=boolean_5)

# group: CSV 匯入/匯出 > 檢閱
# 檢查標題的萃取
watch_標題 = Watch(deconstruct_2.first)

# group: 關鍵字定義
# 使用者可編輯的設定，定義檢查 (大寫字母、關鍵字和所需分隔符號) 所使用的辦公室命名規則。請更新這些設定以符合您的專案或辦公室標準
toUpper = String.ToUpper(string=clean_2)
code_block = CodeBlock { "-"; }
code_block_2 = CodeBlock()
# ---------- code_block_2.designscript (2 lines) ----------
// one output list
["GA","DET","STRUCT"];
# ----------------------------------------
code_block_3 = CodeBlock { 0; }
code_block_4 = CodeBlock { 1; }
code_block_5 = CodeBlock { 2; }

# group: CSV 匯入/匯出 > 規則檢查 (大寫 + 分隔符號)
# 根據名稱產生布林規則輸出。檢查每個名稱是否為大寫，以及是否包含需要的分隔符號字串
eq = clean_2 == toUpper
contains = String.Contains(string=clean_2, searchFor=code_block)

# group: CSV 匯入/匯出 > 關鍵字檢查 (包含任意關鍵字)
# 檢查每個名稱是否至少包含一個已核准的關鍵字。輸出布林清單，其中每個項目都對應到相符的名稱。
getItemAtIndex_3 = List.GetItemAtIndex(list=code_block_2, index=code_block_3)
contains_2 = String.Contains(string=clean_2, searchFor=getItemAtIndex_3)
getItemAtIndex_4 = List.GetItemAtIndex(list=code_block_2, index=code_block_4)
contains_3 = String.Contains(string=clean_2, searchFor=getItemAtIndex_4)
or_ = Or(bool0=contains_2, bool1=contains_3)
getItemAtIndex_5 = List.GetItemAtIndex(list=code_block_2, index=code_block_5)
contains_4 = String.Contains(string=clean_2, searchFor=getItemAtIndex_5)
or_2 = Or(bool0=or_, bool1=contains_4)

# group: CSV 匯入/匯出 > 將檢查合併成最終遮罩
# 使用 and 邏輯將所有規則輸出，合併成一個最終的布林遮罩。此遮罩定義每個名稱是有效還是無效。
and_ = And(bool0=eq, bool1=contains)
and_2 = And(bool0=and_, bool1=or_2)

# group: CSV 匯入/匯出 > 有效名稱與無效名稱
# 輸出: 根據最終遮罩，將輸入名稱清單分為有效和無效結果
filterByBoolMask = List.FilterByBoolMask(list=clean_2, mask=and_2)

# group: CSV 匯入/匯出 > 除錯和摘要
# 以視覺方式檢查，確認輸入、規則和輸出
有效名稱 = Watch(filterByBoolMask.in)
無效名稱 = Watch(filterByBoolMask.out)

# group: CSV 匯入/匯出 > 匯出為 CSV
# 匯出名稱的驗證集
檔案路徑_3 = Filename("..\..\..\..\..\..\Desktop\CSV_Export_Example")
exportCSV = Data.ExportCSV(filePath=檔案路徑_3, data=filterByBoolMask.in)

# group: Excel 匯入/匯出 > 檢閱/分組的樓板
# 相似性群集之後，預覽分組的樓板值。用於驗證群組和命名一致性是否正確
watch_2 = Watch(groupBySimilarity.groupedValues)

# group: Excel 匯入/匯出 > 檢閱/分組的樓板
# 相似性群集之後，預覽分組的樓板值。用於驗證群組和命名一致性是否正確
watch_3 = Watch(groupBySimilarity.groupedIndices)

# group: Excel 匯入/匯出
# 此指令碼從 Excel 匯入結構化資料，根據定義的規則處理和重新組織，然後匯出轉換後的結果供外部使用。在此工作流程中，會匯入一個房間清單、依位置分析並重新排列，並根據空間準則將房間分組為結構化清單，然後匯出處理後的資料用於協調和報告。
integer_slider = IntegerSlider(1, range=0..2 step 1)

# group: Excel 匯入/匯出 > 匯出前插入標題 (可選)
# 在匯出資料的開頭插入一行標題。
# note: 使用 GroupedIndices 拉出原始列
getItemAtIndex_6 = List.GetItemAtIndex(list=clean, index=groupBySimilarity.groupedIndices)
flatten = List.Flatten(list=getItemAtIndex_6, amount=integer_slider)
integer_slider_2 = IntegerSlider(0, range=0..2 step 1)
# note: 匯出前在索引 0 處插入標題
insert = List.Insert(list=flatten, element=deconstruct.first, index=integer_slider_2)

# group: Excel 匯入/匯出 > 檢閱/分組的列結構
# 在展開和匯出之前檢查巢狀列結構
watch_4 = Watch(insert)

# group: Excel 匯入/匯出 > 匯出為 Excel
# 將結構化 Dynamo 資料匯出為 Excel (.xlsx)。支援輸出，方便使用其他工具進行外部檢閱和整合
# note: 匯出檔案名稱必須以 .xlsx 結尾
# 如果已有同名檔案且「覆蓋」設定為 false，則匯出將失敗，不會建立新檔案。
# 若要取代現有檔案，必須啟用「覆蓋」。
檔案路徑_4 = Filename("..\..\..\..\..\..\Desktop\Excel_Export_Example.xlsx")
string_2 = StringInput("\"匯出圖紙\"")
integer_slider_3 = IntegerSlider(0, range=0..100 step 1)
boolean_6 = BoolSelector(true)
openXMLExportExcel = Data.OpenXMLExportExcel(filePath=檔案路徑_4, sheetName=string_2, data=insert, startRow=integer_slider_3, startColumn=integer_slider_3, writeAsString=boolean_6)

# group: 幾何圖形匯入/匯出 > 幾何圖形匯入
# 將 SAT 檔案中的幾何圖形匯入 Dynamo，並轉換為可編輯的曲線、曲面和實體，以進行轉換工作流程
檔案路徑_5 = Filename("..\..\..\..\..\..\Desktop\Geometry_Import_Example.sat")
檔案來源路徑 = FileObject(path=檔案路徑_5)
units = Units("Meters")
# note: 將檔案匯入為 Dynamo 實體/曲面/曲線
importFromSATWithUnits = Geometry.ImportFromSATWithUnits(file_filePath=檔案來源路徑, dynamoUnit=units)
watch_3d_匯入幾何圖形的預覽 = Watch3D(importFromSATWithUnits)

# group: 幾何圖形匯入/匯出 > 除錯/學習群組
# 顯示 Dynamo 認為每個項目是什麼 (實體、曲面、曲線等)。
# 在匯入行為異常時很有用。
type = Object.Type(object=importFromSATWithUnits)
watch_5 = Watch(type)

# group: 幾何圖形匯入/匯出 > 轉換
# 依一個均勻係數調整匯入幾何圖形的比例
XY = Plane.XY()
code_block_6 = CodeBlock { 5; }
scale = Geometry.Scale(geometry=importFromSATWithUnits, plane=XY, xamount=code_block_6, yamount=code_block_6, zamount=code_block_6)

# group: 幾何圖形匯入/匯出 > 匯出為 SAT
# 將更新的幾何圖形匯出為 SAT 檔案。SAT 檔案可匯入至 AutoCAD、Revit 等。
檔案路徑_6 = Filename("..\..\..\..\..\..\Desktop\Geometry_Export_Example.sat")
exportToSAT = Geometry.ExportToSAT(geometry=scale, filePath=檔案路徑_6)
watch_3d_預覽調整比例後的幾何圖形 = Watch3D(scale)
