# Dynamo graph Make a Custom Node.dyn "建立自訂節點" (Dynamo 3.0.3.7597)
# author: Dynamo
# 本文件將協助您熟悉如何建立自訂節點。

# group: 圖表資訊
# 詮釋資料，顏色編碼圖例，命名規則
# note: Dynamo 專案
# 建立自訂節點
# note: Dynamo 版本
# 4.1.0
# note: 主體應用程式版本
# 不適用
# note: ASSOCIATED FILE(S)
# Curve_Validate.dyf
# note: 需要的 Dynamo 套件
# 不適用
# note: 作者/建立日期
# Dynamo 團隊的 Archilizer/2026 年 2 月 4 日
# note: ADDITIONAL COMMENTS
# Custom nodes are typically found in the Add-ons section of the Library.
# This custom node is located under:
# Add-ons → Templates → Curve → Curve_Validate
# If it does not appear:
# Check that the .dyf file is in your custom nodes folder
# Go to:
# Packages → Package Manager → Package Settings → Package/Library Search Paths
# Verify the folder path is listed or add a new path
# Restart Dynamo after adding new custom nodes
# note: 描述
# 本文件將協助您熟悉如何建立自訂節點。
# 為了讓 Dynamo 指令碼乾淨易讀，我們建議您
# 在建立圖表時使用清楚的結構。
# 在〈建立自訂節點〉的 Dynamo Primer 頁面閱讀更多資訊:
# https://primer2.dynamobim.org/zh-tw/6_custom_nodes_and_packages/6-1_custom-nodes/2-creating

# group: 在您的自訂節點內
# note: 此指令碼使用簡單規則檢查和篩選曲線幾何圖形。它會採用輸入曲線 (例如直線、弧等)，驗證每個物件是否存在、是否為有效曲線、滿足選擇性的開放或封閉條件，且長度是否比選擇的最小長度還長。然後，節點會輸出有效曲線、無效曲線，以及布林驗證遮罩 (顯示哪些曲線通過或未通過檢查)，方便更輕鬆地清理幾何圖形、避免後續步驟發生錯誤，並準備資料以在 Dynamo 中進一步處理。

# group: 檢閱
# 除錯和檢查輸出，用於在不影響主要輸出的情況下驗證結果
# note: 用途: 人類可理解的檢查，方便您在不改變結果的情況下確認圖表是否符合預期，例如 Watch 節點、List.Count、摘要字串、「通過/失敗」旗標、錯誤清單、預覽幾何圖形 (Watch3D)，以及範例輸出。

# group: 標註
# note: 用途:
# 用於註解和指令碼資訊。

# group: 輸出
# 圖表產生的最終結果，可匯出或供下游使用
# note: 用途: 預定在下游 (匯出並插入到另一個圖表) 使用的最終結果，例如最終清單、格式化的字串、計算的值、字典/表格，以及可供匯出的資料。

# group: 輸入
# 使用者控制的值，定義在進行任何處理之前的目標資料和設定
# note: 用途: 所有使用者控制的值，用於定義圖表將處理的內容及其運作方式。
# 例如數字滑棒、字串、檔案路徑、布林切換、下拉式清單、初始清單。

# group: 動作
# 處理輸入的核心作業
# note: 用途: 將輸入轉換為結果的主要處理管線。這是「工作」(例如清單清理、對映、篩選、字串邏輯、幾何圖形運算、格式化，以及轉換) 進行的地方。

# group: 在您的自訂節點內 > 輸入
# 使用這些控制來定義「有效」的意義。
# 曲線可以是直線、弧、PolyCurve 或混合曲線類型的清單。
# 使用 flattenDepth 可控制巢狀清單的處理方式。
number = DoubleInput(5)
number_2 = DoubleInput(10)
number_3 = DoubleInput(15)
byCoordinates = Point.ByCoordinates(x=number, y=number_2, z=number_3)
byCoordinates_2 = Point.ByCoordinates(x=number_3, y=number, z=number_2)
byCoordinates_3 = Point.ByCoordinates(x=number_2, y=number_3, z=number)
list_create = List.Create(item0=byCoordinates, item1=byCoordinates_2, item2=byCoordinates_3)
byPoints = NurbsCurve.ByPoints(points=list_create)
number_4 = DoubleInput(1)

# group: 在您的自訂節點內 > 空值和類型驗證
# 在執行曲線幾何圖形檢查之前，篩選出空值和非曲線物件。
# 這可以避免出現警告，讓節點在混合多種輸入時更安全。
flatten = List.Flatten(list=byPoints, amount=number_4)
type = Object.Type(object=flatten)
isNull = Object.IsNull(object=flatten)
not_ = Not(x=isNull)

# group: 在您的自訂節點內 > 要考慮的幾何圖形類型
# 曲線狀幾何圖形
string = StringInput("直線")
boolean = BoolSelector(true)
contains = String.Contains(string=type, searchFor=string, ignoreCase=boolean)
string_2 = StringInput("曲線")
contains_2 = String.Contains(string=type, searchFor=string_2, ignoreCase=boolean)
string_3 = StringInput("弧")
contains_3 = String.Contains(string=type, searchFor=string_3, ignoreCase=boolean)
string_4 = StringInput("PolyCurve")
contains_4 = String.Contains(string=type, searchFor=string_4, ignoreCase=boolean)
or_ = Or(bool0=contains, bool1=contains_2, bool2=contains_3, bool3=contains_4)

# group (continued): 在您的自訂節點內 > 空值和類型驗證
and_ = And(bool0=or_, bool1=not_)
filterByBoolMask = List.FilterByBoolMask(list=flatten, mask=and_)

# group: 在您的自訂節點內 > 輸入
# 使用這些控制來定義「有效」的意義。
# minLength 是最小曲線長度閾值。
# 如果曲線必須是封閉的 (迴路)，請將 requireClosed 設為 true
number_5 = DoubleInput(5)
boolean_2 = BoolSelector(false)

# group: 在您的自訂節點內 > 幾何圖形檢查 (長度和閉合)
# 套用曲線規則:
# 長度必須 ≥ minLength
# 如果 requireClosed 為 true，則曲線必須是封閉的
length = Curve.Length(curve=filterByBoolMask.in)
# note: 短於 MinLength 的曲線無效。
ge = length >= number_5
isClosed = Curve.IsClosed(curve=filterByBoolMask.in)
boolean_3 = BoolSelector(true)
if_ = RefactoredIf(test=boolean_2, true=isClosed, false=boolean_3)
and_2 = And(bool0=ge, bool1=if_)

# group: 在您的自訂節點內 > 分開有效和無效曲線
# 使用最後的布林遮罩，將曲線分為有效和無效清單。
filterByBoolMask_2 = List.FilterByBoolMask(list=filterByBoolMask.in, mask=and_2)

# group: 在您的自訂節點內 > 輸出
# validCurves: 通過驗證的曲線
# invalidCurves: 未通過驗證的曲線
# maskValid: 在其他位置篩選的布林遮罩
code_block = CodeBlock(maskValid=and_2)
# ---------- code_block.designscript (4 lines) ----------
// Boolean mask of validation results
 // true  = valid curve
 // false = invalid curve
 maskValid : bool[]..[];
# ----------------------------------------
code_block_2 = CodeBlock(invalidCurves=filterByBoolMask_2.out)
# ---------- code_block_2.designscript (3 lines) ----------
// Curves that failed validation
 // These should not be used for modelling
 invalidCurves : var[]..[];
# ----------------------------------------
code_block_3 = CodeBlock(validCurves=filterByBoolMask_2.in)
# ---------- code_block_3.designscript (3 lines) ----------
// Curves that passed all validation checks
 // These are safe to use for modelling and automation
 validCurves : var[]..[];
# ----------------------------------------

# group: 輸入
# 使用這些控制來定義「有效」的意義。
# 曲線可以是直線、弧、PolyCurve 或混合曲線類型的清單。
# 使用 flattenDepth 可控制巢狀清單的處理方式
number_6 = DoubleInput(5)
boolean_4 = BoolSelector(false)
number_7 = DoubleInput(5)
number_8 = DoubleInput(10)
number_9 = DoubleInput(15)
byCoordinates_4 = Point.ByCoordinates(x=number_7, y=number_8, z=number_9)
byCoordinates_5 = Point.ByCoordinates(x=number_9, y=number_7, z=number_8)
byCoordinates_6 = Point.ByCoordinates(x=number_8, y=number_9, z=number_7)
list_create_2 = List.Create(item0=byCoordinates_4, item1=byCoordinates_5, item2=byCoordinates_6)
byPoints_2 = NurbsCurve.ByPoints(points=list_create_2)
number_10 = DoubleInput(1)

# group: 自訂節點
# 按兩下節點可將其展開，然後開啟 dyf 檔案。
# note: 此邏輯會壓縮為一個自訂節點，讓曲線檢查變得簡單、可重複使用，且在不同 Dynamo 圖表之間都一致。規則包含在一個清楚且可輕鬆重複使用、更新和分享的工具中，不需要每次重新建構相同的驗證步驟。這樣可以減少錯誤，保持圖表乾淨易讀
curve_Validate = Custom[Curve_Validate](minLength=number_6, requireClosed=boolean_4, curveLikeGeometry=byPoints_2, flattenDepth=number_10)  # 透過檢查空值、類型、長度公差和選擇性的閉合，來驗證曲線幾何圖形。傳回有效/無效曲線、布林遮罩和失敗原因。

# group: 輸出
# 顯示有效曲線、無效曲線和驗證遮罩。
watch = Watch(curve_Validate.invalidCurves)
watch_2 = Watch(curve_Validate.validCurves)
watch_3 = Watch(curve_Validate.maskValid)
