# Dynamo custom node Array.dyf
# category: Core.Lists

on = Input()
start = Input()
end = Input()
step = Input()
number_sequence = BuildSeq(start, end, step, lacing=Longest)
if_ = Conditional(on, number_sequence, start)
