# Dynamo custom node CSV to XYZ.dyf
# category: Input/Output.File

path = Input()
read_file = FileReader(path)
string = StringInput("%0a")
split_string = SplitString(read_file, string)
multiplier = Input()
parse_list_of_lists = Custom[Parse List of Lists](list=split_string, multiplier=multiplier)
xyz = Output(parse_list_of_lists)
