# Dynamo custom node Create Cloud Daylight Job and Send.dyf (Dynamo 0.6.3.25815)
# category: Misc
# Create and Send Cloud Daylight Job

viewname = Input()
export_render_data = ExportDocumentRenderData(viewname)
transaction = Transaction(export_render_data)
upload_render_data = UploadRenderData(transaction)
xDivisions = Input()
bottom_left = Input()
bottom_right = Input()
top_left = Input()
environment = Input()
cloud_daylighting_job = CloudDaylightingJob(viewname, xDivisions, xDivisions, bottom_left, bottom_right, top_left, environment, lacing=Longest)
boolean = BoolSelector(false)
cloud_render = CloudRender(upload_render_data, cloud_daylighting_job, boolean)
result = Output(cloud_render)
