# Dynamo custom node DynamoLogger.Print().dyf (Dynamo 0.6.3.25815)
# category: Debug
# Uses the DynamoLogger and FSchemeInterop Utils class to print to the console

input = Input()
python_script = Python(input)
# ---------- python_script.python (59 lines) ----------
# Default imports
import clr
clr.AddReference('RevitAPI')
clr.AddReference('RevitAPIUI')
from Autodesk.Revit.DB import *
import Autodesk
import sys
import clr

path = r'C:\Autodesk\Dynamo\Core'
sys.path.append(path)
clr.AddReference('DynamoPython')
clr.AddReference('DynamoCore')
clr.AddReference('FSchemeInterop')
clr.AddReference('FScheme')
clr.AddReference('System')
exec_path = r'C:\Autodesk\Dynamo\Core\dll'
sys.path.append(exec_path)
import Dynamo
clr.AddReference('FSharp.Core')
import System
#from DynamoPython import Converters
#The input to this node will be stored in the IN variable.
import DynamoPython
import System.Reflection
from Dynamo import DynamoLogger




x = IN

#here we use reflection to find the internal method (ConvertToVal)

assem = System.Reflection.Assembly.LoadFile(path + '\DynamoPython.dll')

types = assem.GetTypes()

internal = System.Reflection.BindingFlags.NonPublic

con = 0
for type in types:
	if type.Name == 'Converters':
		all_methods = type.GetMethods(System.Reflection.BindingFlags.NonPublic | System.Reflection.BindingFlags.Static )
		for method in all_methods:
			if (method.Name == 'convertToValue'):
				con = method
      
       


x = con.Invoke(con,System.Array[System.Object]([x]))


#DynamoLogger.Instance.Log(Dynamo.FSchemeInterop.Utils.Print(x))
string = Dynamo.FSchemeInterop.Utils.Print(x)
y = string.replace('(', '\n List \t (')
DynamoLogger.Instance.Log(y)
OUT = x
# ----------------------------------------
object = Output(python_script)
watch = Watch(python_script)
