# Dynamo custom node Filter Lighting Data by Face.dyf (Dynamo 0.6.3.26148)
# category: Misc

number = DoubleInput(0)
get_from_list = GetFromList(number)
face = Input()
xyz_sample_points = Input()
data = Input()
python_script_with_variable = Python(face, xyz_sample_points, data)  # "Python Script With Variable Number of Inputs"
# ---------- python_script_with_variable.python (29 lines) ----------
# Default imports
import clr
clr.AddReference('RevitAPI')
clr.AddReference('RevitAPIUI')
from Autodesk.Revit.DB import *
import Autodesk
import sys
import clr
path = r'C:\Autodesk\Dynamo\Core'
exec_path = r'C:\Autodesk\Dynamo\Core\dll'
sys.path.append(path)
sys.path.append(exec_path)
clr.AddReference('LibGNet')
from Autodesk.LibG import *

#The input to this node will be stored in the IN0...INX variable(s).
face = IN0
points = IN1
illum = IN2
outpairs = []

zippeddata =  zip(illum,points)

for pair in zippeddata:
	intersec = face.Project(pair[1])
	if intersec is not None:
		outpairs.append([intersec.UVPoint,pair[0]])
#Assign your output to the OUT variable
OUT = outpairs
# ----------------------------------------
map = Map(get_from_list, python_script_with_variable)
number_2 = DoubleInput(1)
get_from_list_2 = GetFromList(number_2)
map_2 = Map(get_from_list_2, python_script_with_variable)
filtered_illum_data = Output(map_2)
