# Dynamo custom node GetDataFromRender_WriteImage.dyf (Dynamo 0.6.3.18002)
# category: Misc

filePath = Input()
number = DoubleInput(5)
list = Input()
get_from_list = GetFromList(number, list)
to_string = ToString(get_from_list)
number_2 = DoubleInput(0)
get_from_list_2 = GetFromList(number_2, list)
write_image_file = ImageFileWriter(filePath, to_string, get_from_list_2)
transaction = Transaction(write_image_file)
lighting_data_pass_through = Output(list)
