# Dynamo custom node New Sketch Plane.dyf (Dynamo 0.6.2.26052)
# category: Revit.Bake

xyz_basisz = XyzBasisZ(lacing=Longest)
plane = Plane(xyz_basisz, lacing=Longest)
sketch_plane = SketchPlane(plane, lacing=Longest)
