# Dynamo custom node Produce New DayLight Child.dyf (Dynamo 0.6.3.16460)
# category: Misc

family_instances = Input()
parent = Input()
mutation_rate = Input()
mutate_parent_daylight = Custom[Mutate Parent Daylight](family_instances=family_instances, parent=parent, mutation_rate=mutation_rate)
get_family_instance_params = Custom[get family instance params](mutant=mutate_parent_daylight)
transaction = Transaction(get_family_instance_params)
evaluate_daylighting_solution = Custom[Evaluate Daylighting Solution](solution=mutate_parent_daylight)
perform_all = Begin(expr1=transaction, expr2=evaluate_daylighting_solution)
parent_fit = Input()
decideNewParent_with_old_settings = Custom[DecideNewParent_with_old_settings](child_fit=perform_all, parent_fit=parent_fit, child=mutate_parent_daylight, parent=parent, previous_state=get_family_instance_params)
dynamologger_log = Custom[DynamoLogger.Log()](input=decideNewParent_with_old_settings.new_fittess)  # Uses the DynamoLogger and FSchemeInterop Utils class to print to the console
number = DoubleInput(0.75)
greater_than = GreaterThan(parent_fit, number)
empty_list = Empty()
produce_new_daylight_child = Custom[Produce New DayLight Child](parent_fit=decideNewParent_with_old_settings.new_fittess, family_instances=family_instances, parent=decideNewParent_with_old_settings.new_parent, mutation_rate=mutation_rate)
add_to_list = List(decideNewParent_with_old_settings.new_parent, produce_new_daylight_child)
if_ = Conditional(greater_than, empty_list, add_to_list)
child = Output(if_)
watch = Watch(mutate_parent_daylight)
watch_2 = Watch(get_family_instance_params)
watch_3 = Watch(parent_fit)
