# Dynamo custom node ProduceChild.dyf (Dynamo 0.6.3.30451)
# category: Misc

parent_xyz = Input()
goal_xyz = Input()
# note: parent fitness
xyz_distance = XyzDistance(parent_xyz, goal_xyz, lacing=Longest)
# note: if this is true then we are in the base case and we return an empty list,
number = DoubleInput(10)
less_than = LessThan(xyz_distance, number)
# note: this is our evaluation function, it returns a new parent - that parent is either the old parent or the new child we just generated, depending on who is more "fit"
number_2 = DoubleInput(0)
list = NewList(index0=number_2)
# note: only connect to python node to force execution
number_3 = DoubleInput(100)
# note: random number from -1 to 1, python node
random_1_1 = Python(number_3)
# ---------- random_1_1.python (24 lines) ----------
# Default imports
import clr
clr.AddReference('RevitAPI')
clr.AddReference('RevitAPIUI')
from Autodesk.Revit.DB import *
import Autodesk
import sys
import clr
path = r'C:\Autodesk\Dynamo\Core'
exec_path = r'C:\Autodesk\Dynamo\Core\dll'
sys.path.append(path)
sys.path.append(exec_path)
clr.AddReference('LibGNet')
from Autodesk.LibG import *
sys.path.append(r'C:\Program Files (x86)\IronPython 2.7\Lib')
import math,random

#The input to this node will be stored in the IN variable.
dataEnteringNode = IN

rad = random.uniform(-1,1)

#Assign your output to the OUT variable
OUT = rad
# ----------------------------------------
# note: create a random vector
multiply = Multiplication(random_1_1, number_3, lacing=Longest)
# note: move pt by that vector
XYZ = Xyz(multiply, multiply, multiply, lacing=Longest)
add_xyzs = XyzAdd(parent_xyz, XYZ, lacing=Longest)
# note: child fitness
xyz_distance_2 = XyzDistance(add_xyzs, goal_xyz, lacing=Longest)
decideNewParent = Custom[DecideNewParent](child_fit=xyz_distance_2, parent_fit=xyz_distance, child=add_xyzs, parent=parent_xyz)
# note: recursive call to this node produces another child... THIS IS ACTUALLY THE LIST, since the base case of this node returns an empty list, in all other cases it adds an item to the list and returns the list.
produceChild = Custom[ProduceChild](parent_xyz=decideNewParent.new_parent, goal_xyz=goal_xyz)
add_to_list = List(decideNewParent.new_parent, produceChild)
if_ = Conditional(less_than, list, add_to_list)
child_xyz = Output(if_)
