# Dynamo custom node RemapVal.dyf (Dynamo 0.6.3.26148)
# category: Misc

value_to_map = Input()
in_min = Input()
in_max = Input()
out_min = Input()
out_max = Input()
python_script_with_variable = Python(value_to_map, in_min, in_max, out_min, out_max)  # "Python Script With Variable Number of Inputs"
# ---------- python_script_with_variable.python (27 lines) ----------
# Default imports
import clr
clr.AddReference('RevitAPI')
clr.AddReference('RevitAPIUI')
from Autodesk.Revit.DB import *
import Autodesk
import sys
import clr
path = r'C:\Autodesk\Dynamo\Core'
exec_path = r'C:\Autodesk\Dynamo\Core\dll'
sys.path.append(path)
sys.path.append(exec_path)
clr.AddReference('LibGNet')
from Autodesk.LibG import *

#The input to this node will be stored in the IN0...INX variable(s).
x = IN0
in_min = IN1
in_max = IN2

out_min = IN3
out_max = IN4

##arduino map function
y =  (x - in_min) * (out_max - out_min) / (in_max - in_min) + out_min

OUT = y
# ----------------------------------------
remapped_val = Output(python_script_with_variable)
