# Dynamo custom node RenderWithWeatherData_Return List of data.dyf (Dynamo 0.6.3.16460)
# category: Misc

string = StringInput("{3D}")
number = DoubleInput(200)
weatherDataFilePath = Input()
number_2 = DoubleInput(6)
number_3 = DoubleInput(5)
dateTime = MakeDateTime(arg3=number_2, arg6=number_3, lacing=Longest)
parse_weather_data = Custom[Parse Weather Data](WeatherDataFilePath=weatherDataFilePath, dateTimeObject=dateTime)
number_4 = DoubleInput(42)
number_5 = DoubleInput(-71)
create_skymodel_and_environment = Custom[Create Skymodel and Environment](DNI=parse_weather_data.DNI, GHI=parse_weather_data.GHI, DHI=parse_weather_data.DHI, loc_x=number_4, loc_y=number_5, datatime_object=dateTime)  # Creates a skymodel and environment for daylight render, returns the environment object
number_6 = DoubleInput(-100)
number_7 = DoubleInput(3)
XYZ = Xyz(number_6, number_6, number_7, lacing=Longest)
number_8 = DoubleInput(100)
XYZ_2 = Xyz(number_8, number_6, number_7, lacing=Longest)
XYZ_3 = Xyz(number_6, number_8, number_7, lacing=Longest)
create_cloud_daylight_job_and = Custom[Create Cloud Daylight Job and Send](viewname=string, xDivisions=number, environment=create_skymodel_and_environment, bottom_left=XYZ, bottom_right=XYZ_2, top_left=XYZ_3)  # Create and Send Cloud Daylight Job
first_of_list = First(create_cloud_daylight_job_and)
parse_daylighting_file = ParseSDF(first_of_list, lacing=Longest)
number_9 = DoubleInput(0)
number_slider = DoubleSliderInput(7000, range=0..120000)
get_daylighting_grid_image = GetDaylightingForegroundImage(parse_daylighting_file, number_9, number_slider, lacing=Longest)
watch_image = WatchImage(get_daylighting_grid_image)
xyz_distance = XyzDistance(XYZ, XYZ_2, lacing=Longest)
file_path = StringFilename("Y:\Desktop\Autodesk Work IAP\GBS_04R20_266135.csv")
get_daylighting_grid_colors = GetDaylightingColors(parse_daylighting_file, number_9, number_slider, lacing=Longest)
get_daylighting_grid_illuminance = GetDaylightingIlluminanceValues(parse_daylighting_file, number_9, lacing=Longest)  # "Get Daylighting Grid Illuminance Values"
illuminance_to_srgb = IlluminanceToSRGB(get_daylighting_grid_illuminance, lacing=Longest)
get_daylighting_grid_resolution = GetSDFResolution(parse_daylighting_file, number_9, lacing=Longest)
iteration = Input()
get_daylighting_grid_positions = GetDaylightingPositions(parse_daylighting_file, number_9, lacing=Longest)
list = NewList(index0=get_daylighting_grid_image, index1=get_daylighting_grid_colors, index2=get_daylighting_grid_illuminance, index3=illuminance_to_srgb, index4=get_daylighting_grid_resolution, index5=iteration, index6=get_daylighting_grid_positions)
Render_Data = Output(list)
watch = Watch(dateTime)
watch_2 = Watch(create_skymodel_and_environment)
watch_3 = Watch(create_cloud_daylight_job_and)
