# Dynamo custom node BoundingBoxXYZ.dyf (Dynamo 0.7.0.22524)
# category: Migration
# This node represents an upgrade of the <0.6.3 BoundingBoxXYZ node to.

coordinate_system = Input()
width = Input()
length = Input()
height = Input()
byLengths = Cuboid.ByLengths(coordinate_system, width, length, height)
boundingBox = Geometry.BoundingBox(byLengths)
bounding_box = Output(boundingBox)
