# Dynamo custom node ModelCurveFromCurveLoop.dyf (Dynamo 0.7.0.22524)
# category: Migration
# This node represents an upgrade of 0.6.3 ModelCurveFromCurveLoop to 0.7.x.

polyCurve = Input()
curves = PolyCurve.Curves(polyCurve, lacing=Longest)
byCurve = ModelCurve.ByCurve(curves)
ModelCurve = Output(byCurve)
