# Dynamo custom node XyzFromListOfNumbers.dyf (Dynamo 0.7.0.20158)
# category: Migration
# This node represents an upgrade of the 0.6.3 XyzFromListOfNumbers node to 0.7.x

list = Input()
number = DoubleInput(3)
number_2 = DoubleInput(1)
takeEveryNthItem = List.TakeEveryNthItem(list, number, number_2)
number_3 = DoubleInput(2)
takeEveryNthItem_2 = List.TakeEveryNthItem(list, number, number_3)
takeEveryNthItem_3 = List.TakeEveryNthItem(list, number, number)
byCoordinates = Point.ByCoordinates(takeEveryNthItem, takeEveryNthItem_2, takeEveryNthItem_3)
list_2 = Output(byCoordinates)  # "list"
