# Dynamo custom node XyzGrid.dyf (Dynamo 0.7.0.27348)
# category: Migration
# This node represents an upgrade of the 0.6.3 XyzGrid node to 0.7.x

x0 = Input()
x_count = Input()  # "x-count"
x_space = Input()  # "x-space"
code_block = CodeBlock(xOrigin=x0, xCount=x_count, xSpacing=x_space) { xOrigin..#xCount..xSpacing; }
y0 = Input()
y_count = Input()  # "y-count"
y_space = Input()  # "y-space"
code_block_2 = CodeBlock(yOrigin=y0, yCount=y_count, ySpacing=y_space) { yOrigin..#yCount..ySpacing; }
z0 = Input()
z_count = Input()  # "z-count"
z_space = Input()  # "z-space"
code_block_3 = CodeBlock(zOrigin=z0, zCount=z_count, zSpacing=z_space) { zOrigin..#zCount..zSpacing; }
code_block_4 = CodeBlock(x=code_block, y=code_block_2, z=code_block_3) { Point.ByCoordinates(x<3>,y<2>,z<1>); }
flatten = Flatten(code_block_4)
Point = Output(flatten)  # "Point[]"
