# Dynamo custom node Curve_Validate.dyf (Dynamo 3.0.3.7597)
# category: Standards.Curve
# Validates curve geometry by checking nulls, type, length tolerance, and optional closure. Returns valid/invalid curves, boolean mask, and failure reasons.

# note: To create inputs and outputs of a custom node, type its definition directly into the Input or Output node.
# Double-click the Input (or Output) node
# Type the definition as text
# Use // to write comments
# Write the name, type, and default value
# That text becomes the input/output port of the custom node
# note: Typical example of input/output :
# double  → number (decimal)
# int     → integer
# bool    → true/false
# string  → text
# var     → any type
# var[]      → list
# var[]..[]  → nested lists (any depth)

# group: Annotations
# note: USE:
# FOR COMMENTS AND SCRIPT INFO

# group: Review
# DEBUG AND CHECK OUTPUTS, USED TO VERIFY RESULTS WITHOUT AFFECTING THE MAIN OUTPUTS
# note: USE : Human-readable checks so you can verify the graph is doing what you expect, without changing results such as  :Watch nodes, List.Count, summary strings, “PASS/FAIL” flags, error lists, preview geometry (Watch3D), sample outputs.

# group: Outputs
# FINAL RESULTS PRODUCED BY THE GRAPH, READY FOR EXPORT OR DOWNSTREAM USE
# note: USE: Final results intended to be used downstream (exported, plugged into another graph) such as : Final lists, formatted strings, calculated values, dictionaries/tables, export-ready data

# group: Actions
# CORE OPERATIONS THAT PROCESS THE INPUTS
# note: USE: The main processing pipeline that transforms inputs into results. This is where the “work” happens such as : List cleaning, mapping, filtering, string logic, geometry operations, formatting, conversions.

# group: Inputs
# USER-CONTROLLED VALUES THAT DEFINE THE TARGET DATA AND SETTINGS BEFORE ANY PROCESSING OCCURS
# note: USE: All user-controlled values that define what the graph will process and how it should behave.
# such as : Number sliders, strings, file paths, boolean toggles, dropdowns, initial lists.

# group: Inputs
# Use these controls to define what “valid” means.
# curves can be a list of Lines, Arcs, PolyCurves, or mixed curve types.
# Use flattenDepth to control how nested lists are handled.
# note: Curves can be a single curve or a list. Nested lists are supported via flattenDepth.
curveLikeGeometry = Input(curveLikeGeometry: var[]..[])  # Curves to check and validate You can connect lines, arcs, polycurves, or any curve geometry
flattenDepth = Input(flattenDepth: int = -1)  # List structure control -1 fully flatten all nested lists 0 no flatten 1 flatten one level

# group: Null and type validation
# Filters out nulls and non-curve objects before running curve geometry checks.
# This prevents warnings and makes the node safer for mixed inputs.
flatten = List.Flatten(list=curveLikeGeometry, amount=flattenDepth)
type = Object.Type(object=flatten)
isNull = Object.IsNull(object=flatten)
not_ = Not(x=isNull)

# group: Type of geometry to consider
# Curve like geometry
string = StringInput("Line")
boolean = BoolSelector(true)
contains = String.Contains(string=type, searchFor=string, ignoreCase=boolean)
string_2 = StringInput("Curve")
contains_2 = String.Contains(string=type, searchFor=string_2, ignoreCase=boolean)
string_3 = StringInput("Arc")
contains_3 = String.Contains(string=type, searchFor=string_3, ignoreCase=boolean)
string_4 = StringInput("PolyCurve")
contains_4 = String.Contains(string=type, searchFor=string_4, ignoreCase=boolean)
or_ = Or(bool0=contains, bool1=contains_2, bool2=contains_3, bool3=contains_4)

# group (continued): Null and type validation
and_ = And(bool0=or_, bool1=not_)
filterByBoolMask = List.FilterByBoolMask(list=flatten, mask=and_)

# group: Inputs
# Use these controls to define what “valid” means.
# minLength is a minimum curve length threshold.
# Set requireClosed to true if curves must be closed (loops)
minLength = Input(minLength: double = 0.01)  # Minimum allowed curve length Curves shorter than this value will be marked invalid
requireClosed = Input(requireClosed: bool = false)  # Closed rule true = closed curves allowed false = open curves allowed

# group: Geometry checks (length and closure)
# Applies curve rules:
# length must be ≥ minLength
# if requireClosed is true, curve must be closed
length = Curve.Length(curve=filterByBoolMask.in)
# note: Curves shorter than minLength are invalid.
ge = length >= minLength
isClosed = Curve.IsClosed(curve=filterByBoolMask.in)
boolean_2 = BoolSelector(true)
if_ = RefactoredIf(test=requireClosed, true=isClosed, false=boolean_2)
and_2 = And(bool0=ge, bool1=if_)

# group: Split valid and invalid curves
# Uses the final boolean mask to separate curves into valid and invalid lists.
filterByBoolMask_2 = List.FilterByBoolMask(list=filterByBoolMask.in, mask=and_2)

# group: Outputs
# validCurves: curves that passed validation
# invalidCurves: curves that failed validation
# maskValid: boolean mask for filtering elsewhere
validCurves = Output(filterByBoolMask_2.in)  # "validCurves : var[]..[]"; Curves that passed all validation checks These are safe to use for modelling and automation
invalidCurves = Output(filterByBoolMask_2.out)  # "invalidCurves : var[]..[]"; Curves that failed validation These should not be used for modelling
maskValid = Output(and_2)  # "maskValid : bool[]..[]"; Boolean mask of validation results true  = valid curve false = invalid curve

# group: Script information
# metadata, colour code legend, naming rules
dynamo_version = StringInput("4.1.0")
script_name = StringInput("Dynamo_workflow_template_Custom_node")
date_created = StringInput("22.01.2026")
summary = StringInput("This document will help you get familiarised with the  creation of Custom node. You cn also right click on the Custom node and check the dyf file. ")
author = StringInput("Chloe.pegeot@autodesk.com ")
status = StringInput("Ready for review")
date_modified = StringInput("28.01.2026")
legal_notice = StringInput("""Copyright  2026 Autodesk
 
Without prior written consent of Autodesk this code may not be published or duplicated. """)
host_application_version = StringInput("/")
host_application = StringInput("/")

information = CodeBlock()
# ---------- information.designscript (5 lines) ----------
"To keep Dynamo scripts neat and readable, we recommend following a clear
structure when creating graphs.

Read more on the Dynamo Primer page about Creating a Custom Node:
https://primer.dynamobim.org/10_Custom-Nodes/10-2_Creating.html";
# ----------------------------------------
information_2 = CodeBlock()
# ---------- information_2.designscript (12 lines) ----------
"Custom nodes are typically found in the Add-ons section of the Library.
This custom node is located under:
Add-ons → Standards → Curve → Curve_Validate

If it does not appear:

Check that the .dyf file is in your custom nodes folder

Go to:
Packages → Package Manager → Package Settings → Package/Lirary Search Paths
Verify the folder path is listed or add a new path
Restart Dynamo after adding new custom nodes";
# ----------------------------------------
