# Dynamo graph How_to _create _a _dynamo_file.dyn (Dynamo 3.6.0.9395)
# author: Dynamo
# This document will help you get familiarised with a standardised workflow and the following important steps.

# group: HOW TO CREATE A DYNAMO SCRIPT > Example
# note: Name generator

# group: Group naming standards Inputs → Action → Outputs → Review > Inputs
# USER-CONTROLLED VALUES THAT DEFINE THE TARGET DATA AND SETTINGS BEFORE ANY PROCESSING OCCURS
# note: USE: All user-controlled values that define what the graph will process and how it should behave.
# such as : Number sliders, strings, file paths, boolean toggles, dropdowns, initial lists.

# group: Group naming standards Inputs → Action → Outputs → Review > Actions
# CORE OPERATIONS THAT PROCESS THE INPUTS
# note: USE: The main processing pipeline that transforms inputs into results. This is where the “work” happens such as : List cleaning, mapping, filtering, string logic, geometry operations, formatting, conversions.

# group: Group naming standards Inputs → Action → Outputs → Review > Outputs
# FINAL RESULTS PRODUCED BY THE GRAPH, READY FOR EXPORT OR DOWNSTREAM USE
# note: USE: Final results intended to be used downstream (exported, plugged into another graph) such as : Final lists, formatted strings, calculated values, dictionaries/tables, export-ready data

# group: Group naming standards Inputs → Action → Outputs → Review > Review
# DEBUG AND CHECK OUTPUTS, USED TO VERIFY RESULTS WITHOUT AFFECTING THE MAIN OUTPUTS
# note: USE : Human-readable checks so you can verify the graph is doing what you expect, without changing results such as  :Watch nodes, List.Count, summary strings, “PASS/FAIL” flags, error lists, preview geometry (Watch3D), sample outputs.

# group: Group naming standards Inputs → Action → Outputs → Review > Annotations
# note: USE:
# FOR COMMENTS AND SCRIPT INFO

# group: Script information
# metadata, colour code legend, naming rules
legal_notice = StringInput("""Copyright  2026 Autodesk
 
Without prior written consent of Autodesk this code may not be published or duplicated. """)
status = StringInput("Ready for review")
date_modified = StringInput("26.01.2026")
dynamo_version = StringInput("4.1.0")
author = StringInput("Chloe.pegeot@autodesk.com ")
date_created = StringInput("12.01.2026")
script_name = StringInput("How_to_create_a_dynamo_script")
summary = StringInput("This document will help you get familiarised with a standardised workflow and the following important steps")
host_application = StringInput("/")
host_application_version = StringInput("/")

# group: HOW TO CREATE A DYNAMO SCRIPT > Script Information
# metadata, colour code legend, naming rules
legal_notice_2 = StringInput("""Copyright  2026 Autodesk
 
Without prior written consent of Autodesk this code may not be published or duplicated. """)
date_modified_2 = StringInput("DD-MM-YYYY")
status_2 = StringInput("draft / testing / released")
author_2 = StringInput("XXX")
summary_2 = StringInput("""Script description should state 
what the script does,  what data it uses,
what rules it applies, what it outputs,
where and how it runs (host app + version) and any key limits""")
script_name_2 = StringInput("XXX")
# note: All dates must follow office standard. If none is defined, use DD-MM-YYYY
date_created_2 = StringInput("DD-MM-YYYY")
dynamo_version_2 = StringInput("XXX")
host_application_2 = StringInput("XXX")
host_application_version_2 = StringInput("XXX")

# group: HOW TO CREATE A DYNAMO SCRIPT > Dynamo player Inputs → Actions → Outputs
# Dynamo Player allows Dynamo scripts to be run without opening the Dynamo interface.
# Users interact only with predefined inputs and run the script
# note: Right click on your input node and select "Is Input"
your_input = StringInput("Dynamo player")  # graph input
your_action = String.ToUpper(string=your_input)
# note: Right click on your input node and select "Is Output"
your_output = Watch(your_action)  # graph output

# group: HOW TO CREATE A DYNAMO SCRIPT > Node naming standards
# note: Do not change the node name instead use parenthesis
string = StringInput("")
# note: DO
string_input_1 = StringInput("")
# note: DO NOT DO
# note: Update these rules based on your office standards
input_1 = StringInput("")
typical_do_rules = CodeBlock()
# ---------- typical_do_rules.designscript (3 lines) ----------
// Rename key nodes only (inputs, rules, outputs, decision logic)
// Use notes to add context to your script
// Use capitalisation consistently (e.g. Title Case or camelCase, not mixed)
# ----------------------------------------
typical_do_not_rules = CodeBlock()
# ---------- typical_do_not_rules.designscript (3 lines) ----------
// Do not rename every node in the graph
// Do not leave important nodes with default names if they affect logic
// Do not use vague names like "Data", "Stuff", "Fix", "Test"
# ----------------------------------------

# group: HOW TO CREATE A DYNAMO SCRIPT > Script file naming standards
# In order to understand the purpose or intended usage of a script by its name we suggest to follow a naming pattern similar to the convention of BIM execution plan :
string_2 = StringInput("-")
organisation = CodeBlock { "AUT"; }
function_fields = CodeBlock { BLD  = "BLD"; STR  = "STR"; MEP  = "MEP"; INFR = "INFR"; }
description = CodeBlock { "Logical_description"; }
dynamo_version_3 = CodeBlock { "D303"; }
script_version_only_for_backup = CodeBlock { "V2"; }  # "Script-Version (only for backup files)"
assembly_order = String.Join(separator=string_2, string0=organisation, string1=function_fields.BLD, string2=description, string3=dynamo_version_3, string4=script_version_only_for_backup)
name_example = Watch(assembly_order)
# note: Idea on naming
naming_structure = CodeBlock()
# ---------- naming_structure.designscript (3 lines) ----------
["Organisation  | Function fields | Description         | Dynamo-Version | Script-Version",
"AUT            |BLD              | Logical_description | D303           | V3"
];
# ----------------------------------------
# note: DO NOT EDIT :
# note: Function fields describe the main working area/ domain of the script
function_fields_2 = CodeBlock()
# ---------- function_fields_2.designscript (4 lines) ----------
BLD  = "BLD  — Building design";
STR  = "STR  — Structural design";
MEP  = "MEP  — Mechanical / Electrical / Plumbing";
INFR = "INFR — Infrastructure";
# ----------------------------------------

# group: HOW TO CREATE A DYNAMO SCRIPT
# A visual guide to structure, naming and best practice
# note: Use Watch nodes only at key checkpoints
# Freeze non-active script
# note: Before running a script :
# Check Inputs are set
# Review Preview/Checks
# Run once manually before using Dynamo Player
# Save the file after successful run
# note: This document will help you get familiarised with a standardised workflow and the following important steps
# note: Background/ back panel
information = CodeBlock()
# ---------- information.designscript (5 lines) ----------
"To keep Dynamo scripts neat and readable, we recommend following a clear
structure when creating graphs.

For more information, read the Dynamo Primer page on best-practice graph strategies:
https://primer.dynamobim.org/13_Best-Practice/13-2_Graph-Strategies.html";
# ----------------------------------------
