# Dynamo graph ArduMote iPad udp listener.dyn

# note: Milliseconds between Samples
number = DoubleInput(10)
execution_interval = ExecuteInterval(number)
# note: UDP Port for ArduMote on iPad
number_2 = DoubleInput(7777)
# note: ArduMote inputs being sent to Dynamo
udp_listener = UDPListener(execution_interval, number_2)
watch = Watch(udp_listener)
