# Dynamo graph arduino driving stacked families.dyn

number = DoubleInput(1)
family_type_selector = FamilyTypeSelector(index=16)
string = StringInput("increment")
Family_Instance_Creator_Indexed = Output(family_type_selector, string)  # "Family Instance Creator - Indexed"
number_2 = DoubleInput(1)
number_slider = DoubleSliderInput(200, range=0..500)
execution_interval = ExecuteInterval(number_slider)
arduino = Arduino(execution_interval)
watch = Watch(arduino)
string_number = String2Num(watch)
number_3 = DoubleInput(1024)
division = Division(string_number, number_3)
watch_2 = Watch(division)
number_4 = DoubleInput(1)
number_sequence = BuildSeq(number_2, watch_2, number_4)
map = Map(Family_Instance_Creator_Indexed, number_sequence)
