# Dynamo graph UseGeometryObject.dyn (Dynamo 0.7.0.21303)

code_block = CodeBlock { Point.ByCoordinates(0, 0); Point.ByCoordinates(10, 10); Point.ByCoordinates(0, 20); }
create = List.Create(code_block.out0, code_block.out1, code_block.out2)
byPoints = NurbsCurve.ByPoints(create)
length = Curve.Length(byPoints)
watch = Watch(length)
doubleLength = ZeroTouchEssentials.ZeroTouchEssentials.DoubleLength(byPoints)
watch_2 = Watch(doubleLength)
