# Dynamo graph COVID occupancy by keywords.dyn (Dynamo 2.6.1.8786)

# group: Elements in active view
all_elements_in_active_view = ElementsInView()
getCategory = Element.GetCategory(element=all_elements_in_active_view)
name = Category.Name(category=getCategory)
code_block = CodeBlock { "Furniture"; }
contains = String.Contains(str=name, searchFor=code_block)
# note: IN: Furniture Elements in view
filterByBoolMask = List.FilterByBoolMask(list=all_elements_in_active_view, mask=contains)

# group: Input: element keywords
select_seats_by_family_type = StringInput("chair, stool, seat")  # "Select seats by family/type keywords"; graph input

# group: Identify seat elements by keywords
code_block_2 = CodeBlock(furniture=filterByBoolMask.in) { furniture; }
getFamily = FamilyInstance.GetFamily(familyInstance=code_block_2)
name_2 = Family.Name(family=getFamily)
code_block_3 = CodeBlock(keywords=select_seats_by_family_type) { keywords; }
code_block_4 = CodeBlock { ","; }
# note: Process keyword strings
split = String.Split(str=code_block_3, separator0=code_block_4)
trimLeadingWhitespace = String.TrimLeadingWhitespace(str=split)
trimTrailingWhitespace = String.TrimTrailingWhitespace(str=trimLeadingWhitespace)
code_block_5 = CodeBlock { true; }
contains_2 = String.Contains(str=name_2, searchFor=trimTrailingWhitespace, ignoreCase=code_block_5, lacing=CrossProduct)
countTrue = List.CountTrue(list=contains_2@L2)
elementType = Element.ElementType(element=code_block_2)
code_block_6 = CodeBlock { "Type Name"; }
getParameterValueByName = Element.GetParameterValueByName(element=elementType, parameterName=code_block_6)
contains_3 = String.Contains(str=getParameterValueByName, searchFor=trimTrailingWhitespace, ignoreCase=code_block_5, lacing=CrossProduct)
countTrue_2 = List.CountTrue(list=contains_3@L2)
code_block_7 = CodeBlock(num_true_families=countTrue, num_true_types=countTrue_2)
# ---------- code_block_7.designscript (3 lines) ----------
// True if any type name or family name
// tests true
num_true_families + num_true_types > 0;
# ----------------------------------------
# note: IN: All seats where people could sit
# OUT: All other furniture, assumed fixed
filterByBoolMask_2 = List.FilterByBoolMask(list=code_block_2, mask=code_block_7)

# group: Level of active view
current = Document.Current()
activeView = Document.ActiveView(document=current)
code_block_8 = CodeBlock { "Associated Level"; }
# note: Level associated with active view (string)
getParameterValueByName_2 = Element.GetParameterValueByName(element=activeView, parameterName=code_block_8)
categories = Categories("OST_Levels")
all_elements_of_category = ElementsOfCategory(Category=categories)
name_3 = Level.Name(level=all_elements_of_category)
contains_4 = String.Contains(str=name_3, searchFor=getParameterValueByName_2)
filterByBoolMask_3 = List.FilterByBoolMask(list=all_elements_of_category, mask=contains_4)
firstItem = List.FirstItem(list=filterByBoolMask_3.in)
elevation = Level.Elevation(level=firstItem)
code_block_9 = CodeBlock(level_name=getParameterValueByName_2, level_elevation=elevation) { level_name; level_elevation; }

# group: Room geometry on level in active view
categories_2 = Categories("OST_Rooms")
all_elements_of_category_2 = ElementsOfCategory(Category=categories_2)
code_block_10 = CodeBlock { "Level"; }
getParameterValueByName_3 = Element.GetParameterValueByName(element=all_elements_of_category_2, parameterName=code_block_10)
code_block_11 = CodeBlock(level_name=code_block_9.level_name, level_elevation=code_block_9.level_elevation) { level_name; level_elevation; }
contains_5 = String.Contains(str=getParameterValueByName_3, searchFor=code_block_11.level_name)
# note: Room associated with level in active view
filterByBoolMask_4 = List.FilterByBoolMask(list=all_elements_of_category_2, mask=contains_5)
# note: Errors are OK!
# Null values may correspond to rooms associated with the level that aren't placed, so they don't have geometry.
geometry = Element.Geometry(element=filterByBoolMask_4.in)
firstItem_2 = List.FirstItem()  # unwired: list
# note: List.Map is used instead of the List@Level operator in case the first item in the preceding list is null. This construction ensures results for each item in the list in that case.
map = List.Map(list=geometry, f_x=firstItem_2)
isNull = Object.IsNull(obj=map)
# note: OUT: Room geometry associated with the level
filterByBoolMask_5 = List.FilterByBoolMask(list=map, mask=isNull)
code_block_12 = CodeBlock(elevation=code_block_11.level_elevation) { -elevation; }
# note: Room geometry translated to XY plane
translate = Geometry.Translate(geometry=filterByBoolMask_5.out, zTranslation=code_block_12)

# group: Cluster seats by room
code_block_13 = CodeBlock(seat_elements=filterByBoolMask_2.in) { seat_elements; }
boundingBox = Element.BoundingBox(element=code_block_13)
# note: Seat points
code_block_14 = CodeBlock(bbox=boundingBox) { BoundingBoxCenter(bbox, 0); }
code_block_15 = CodeBlock(room_geomm=translate) { room_geomm; }
volume = Solid.Volume(solid=code_block_15)
# note: Sort room geometries by volume so that if a furniture element should appear in multiple rooms, choosing the first possible room will select the smaller possibility.
sortByKey = List.SortByKey(list=code_block_15, keys=volume)
# note: Vertical line projecting upwards from each location point used to find the intersection with the room volumes. Accounts for small offsets or inaccuracies in room or placement point definitions. Height of the line set by the height of the tallest room.
lastItem = List.LastItem(list=sortByKey.sorted_list)
byGeometry = BoundingBox.ByGeometry(geom=lastItem)
maxPoint = BoundingBox.MaxPoint(boundingBox=byGeometry)
minPoint = BoundingBox.MinPoint(boundingBox=byGeometry)
code_block_16 = CodeBlock(max=maxPoint, min=minPoint) { max.Z - min.Z; }
translate_2 = Geometry.Translate(geometry=code_block_14, zTranslation=code_block_16)
byStartPointEndPoint = Line.ByStartPointEndPoint(startPoint=code_block_14, endPoint=translate_2)
reverse = List.Reverse(list=sortByKey.sorted_list)
# note: Ask whethet the vertical line corresponding to each seating object intersects any of the room volumes.
# Note cross-lacing!
doesIntersect = Geometry.DoesIntersect(geometry=byStartPointEndPoint, other=reverse, lacing=CrossProduct)
code_block_17 = CodeBlock { true; }
# note: Returns the index of the first positive test result. It's possible that an element may test positive for inclusion in more than one room, so this will choose the largest room in the even that there are more than one. (It's the largest room because the list of room volumes prior to this was reversed, with the largest rooms listed first.)
# Elements not testing positive for any room will all end up in their own subgroup.
indexOf = List.IndexOf(list=doesIntersect@L2, element=code_block_17)
# note: Seat and furniture elements
# Grouped by room
groupByKey = List.GroupByKey(list=code_block_13, keys=indexOf)
# note: Seat element locations in XY plane
# Grouped by room
groupByKey_2 = List.GroupByKey(list=code_block_14, keys=indexOf)
code_block_18 = CodeBlock()
# ---------- code_block_18.designscript (10 lines) ----------
// Central point of a bounding box
// as projected to the specified z-height
def BoundingBoxCenter(bbox:var, z:var)
{
	minPt = BoundingBox.MinPoint(bbox);
	maxPt = BoundingBox.MaxPoint(bbox);
	x = (maxPt.X + minPt.X)/2;
	y = (maxPt.Y + minPt.Y)/2;
	return = Point.ByCoordinates(x, y, z);
};
# ----------------------------------------

# group: Input: Minimum Separation
minimum_separation_project_units = DoubleInput(6)  # graph input

# group: Cluster seats by proximity
code_block_19 = CodeBlock(seat_info=groupByKey.groups, seat_pts=groupByKey_2.groups, min_separation=minimum_separation_project_units) { seat_info; seat_pts; min_separation; }
python_script = Python(IN[0]=code_block_19.seat_info, IN[1]=code_block_19.seat_pts, IN[2]=code_block_19.min_separation)
# ---------- python_script.python (151 lines) ----------
"""Cluster points as groups connected by any shared
distances less than the threshold"""

import sys
import clr
clr.AddReference('ProtoGeometry')
from Autodesk.DesignScript.Geometry import *
import math

# Object definition for objects associated with locations
class Item:
    def __init__(self, object, point):
        #self.index = index
        self.object = object
        self.point = point
        self.cluster = None
    
    # Distance between item and another existing item2
    def DistanceTo(self, item2):
        pt1 = self.point
        pt2 = item2.point
        return math.sqrt((pt1.X-pt2.X)**2 + (pt1.Y-pt2.Y)**2 + (pt1.Z-pt2.Z)**2)

class Cluster:
    def __init__(self, index, items):
        self.index = index
        self.items = []
        self.AddItems(items)
    
    # Update cluster and Item instances to add to this cluster
    def AddItems(self, items):
        if isinstance(items, list):
            for item in items:
                self.items.append(item)
                item.cluster = self
        else:
            self.items.append(items)
            items.cluster = self


def GroupByProximity(objects, locations, threshold):
	# Initialize item objects
	items = []
	for i in range(len(locations)):
	    items.append(Item(objects[i],locations[i]))
	
	
	# Set of unique indices used to identify clusters. May not be in order.
	clusters = []
	cluster_indices = []
	next_cluster_index = 0
	
	# Step through each item to create a new cluster or add to an existing cluster
	for i in range(len(items)):
	    items_nearby = []
	    items_nearby_cluster_index = []
	    
	    # Including the origin item, identify nearby items and their cluster indices
	    for j in range(len(items)):
	        if i == j or items[i].DistanceTo(items[j]) <= threshold:
	            # Note nearby item and its cluster assignment (None if unclustered)
	            items_nearby.append(items[j])
	            if items[j].cluster:
	                items_nearby_cluster_index.append(items[j].cluster.index)
	    
	    # Unique set of associated clusters
	    unique_clusters = list(set(items_nearby_cluster_index))
	    
	    # Case: No nearby items are already clustered
	    if not unique_clusters or unique_clusters[0] == None:
	        # Create a new cluster and add all relevant items
	        c = Cluster(next_cluster_index, items_nearby)
	        clusters.append(c)
	        cluster_indices.append(next_cluster_index)
	        next_cluster_index += 1
	    # Case: All nearby items are already clustered and in the same cluster
	    elif(
	        len(unique_clusters) == 1
	        and len(items_nearby) == len(items_nearby_cluster_index)
	    ):
	        continue
	    # Case: Any heterogeneous set of cluster assignments
	    else:
	        # Find new cluster
	        lowest_cluster_index = unique_clusters[0]
	        new_ind = cluster_indices.index(lowest_cluster_index)
	        new_cluster = clusters[new_ind]
	        
	        # Update already-clustered items to the new common cluster
	        for j in range(1,len(unique_clusters)):
	            # Find cluster to be merged
	            old_ind = cluster_indices.index(unique_clusters[j])
	            old_cluster = clusters[old_ind]
	            # Merge old cluster to the new common cluster
	            new_cluster.AddItems(old_cluster.items)
	            # Delete old cluster
	            clusters.pop(old_ind)
	            cluster_indices.pop(old_ind)
	        
	        # Add not-yet clustered items to the new common cluster
	        for j in range(len(items_nearby)):
	            if not items_nearby[j].cluster:
	                new_cluster.AddItems(items_nearby[j])
	
	# Format Output
	clustered_objects = []
	clustered_points = []
	for k in range(len(clusters)):
	    object_set = []
	    point_set = []
	    for m in range(len(clusters[k].items)):
	        object_set.append(clusters[k].items[m].object)
	        point_set.append(clusters[k].items[m].point)
	    
	    clustered_objects.append(object_set)
	    clustered_points.append(point_set)
	    
	answer = []
	answer.append(clustered_objects)
	answer.append(clustered_points)
	return answer


# Inputs
objects = IN[0]
locations = IN[1]
threshold = IN[2]

# Calculations
obj = []
loc = []

if isinstance(locations, list):
	# List of lists is supplied
	if isinstance(locations[0], list):
		for i in range(len(locations)):
			obj_set, loc_set = GroupByProximity(objects[i], locations[i], threshold)
			obj.extend(obj_set)
			loc.extend(loc_set)
	
	# Just a simple list is supplied
	else:
		obj, loc = GroupByProximity(objects, locations, threshold)

# Single item is supplied
else:
	obj = objects
	loc = locations

# Format Outputs
OUT = [obj, loc]
# ----------------------------------------
code_block_20 = CodeBlock(OUT=python_script) { seat_info = OUT[0]; seat_pts = OUT[1]; }

# group: Choose occupied desks
# note: Maximum-packing solutions per group with minimum separation distance
code_block_21 = CodeBlock(seat_info=code_block_20.seat_info, locations=code_block_20.seat_pts, min_separation=minimum_separation_project_units) { seat_info; locations; min_separation; }
code_block_22 = CodeBlock(elements=code_block_21.seat_info, locations=code_block_21.locations, threshold=code_block_21.min_separation) { elements; locations; threshold; }
# note: Indices for all possible maximum-packing solutions
python_script_2 = Python(IN[0]=code_block_22.elements, IN[1]=code_block_22.locations, IN[2]=code_block_22.threshold)
# ---------- python_script_2.python (281 lines) ----------
import sys
import clr
clr.AddReference('ProtoGeometry')
from Autodesk.DesignScript.Geometry import *
import math

# Distance between points
def DistanceTo(pt1, pt2):
    return math.sqrt((pt1.X-pt2.X)**2 + (pt1.Y-pt2.Y)**2 + (pt1.Z-pt2.Z)**2)

# Create a matrix of distances between each point
def DistanceMatrix(pts):
    dist = []
    for i in range(len(pts)):
        dist_row = []
        for j in range(len(pts)):
            dist_row.append(DistanceTo(pts[i],pts[j]))
        dist.append(dist_row)
    return dist

# Return the average of a list of numbers
def Average(nums):
    sum = 0
    for num in nums:
        sum += num
    return sum/len(nums)

# Average of the smallest n numbers among a list of numbers
def AverageOfSmallestN(nums, n):
    nums.sort()
    num_contributors = min([n, len(nums)])
    sum = 0
    for i in range(num_contributors):
        sum += nums[i]
    return sum/num_contributors

# Average for a set of points
def PointAverage(points):
    numPts = len(points)
    x = y = z = 0
    for i in range(numPts):
        x += points[i].X
        y += points[i].Y
        z += points[i].Z
    return Point.ByCoordinates(x/numPts, y/numPts, z/numPts)

# Given a set of points, find the indices of the most densely-packed set of
# points for which no two points are closer together than a given threshold
# value. Requires specifying an already-activated starting index.
# Adds the next closest possible point each iteration.
def ActiveIndices_1(points, dist, threshold, start):
    # Initialize tracking arrays
    indices_remaining = range(len(points))
    indices_activated = []
    
    # Mark first activated position
    indices_activated.append(int(start))
    indices_remaining.pop(int(start))
    
    # Iteratively identify and activate the next nearest point to any already
    # activated point and discard from consideration any found to be too close
    while len(indices_remaining) > 0:
        # For each point remaining, find shortest distance to an activated point
        shortest_distances = []
        for i, ind_unk in enumerate(indices_remaining):
            # Distance to each activated point
            distance_to_each_activated = []
            for j, ind_act in enumerate(indices_activated):
                distance_to_each_activated.append(dist[ind_unk][ind_act])
            
            # Shortest distance to any activated point
            shortest_distances.append(sorted(distance_to_each_activated)[0])
        
        # Order the remaining point indices by their shortest distances
        ordered_dists, ordered_indices \
        = zip(*sorted(zip(shortest_distances, indices_remaining)))
        
        # Get rid of too-close points and activate the next closest point    
        for i in range(len(ordered_indices)):
            # Discard point if shortest distance is less than threshold
            if ordered_dists[i] < threshold:
                # Remove point index from indices_remaining
                ind = indices_remaining.index(ordered_indices[i])
                indices_remaining.pop(ind)
            
            # Mark the point as active
            else:
                # Add point index to indices_activated
                indices_activated.append(ordered_indices[i])
                
                # Remove point index from indices_remaining
                ind = indices_remaining.index(ordered_indices[i])
                indices_remaining.pop(ind)
                
                # Proceed to the next iteration to find next active point
                break
    
    return sorted(indices_activated)

# Given a set of points, find the indices of the most densely-packed set of
# points for which no two points are closer together than a given threshold
# value. Requires specifying an already-activated starting index.
# Adds new points each iteration by smallest average distance to active points.
def ActiveIndices_2(points, dist, threshold, start):
    # Initialize tracking arrays
    indices_remaining = range(len(points))
    indices_activated = []
    
    # Mark first activated position
    indices_activated.append(int(start))
    indices_remaining.pop(int(start))
    
    # Iteratively identify and activate the next nearest point to any already
    # activated point and discard from consideration any found to be too close
    counter = 0
    while len(indices_remaining) > 0:
        counter += 1
        # For each point remaining, find shortest distance to an activated point
        average_distances = []
        shortest_distances = []
        items_to_discard = []
        for i, ind_unk in enumerate(indices_remaining):
            # Distance to each activated point
            distance_to_each_activated = []
            for j, ind_act in enumerate(indices_activated):
                distance_to_each_activated.append(dist[ind_unk][ind_act])
            
            # Record the average distance or mark point for removal
            shortest_distance = sorted(distance_to_each_activated)[0]
            if shortest_distance >= threshold: 
                #average_distances.append(Average(distance_to_each_activated))
                average_distances.append(AverageOfSmallestN(distance_to_each_activated,4))
            else:
                items_to_discard.append(ind_unk)
        
        # Discard point if too close to any active point
        for i in reversed(range(len(items_to_discard))):
            index = indices_remaining.index(items_to_discard[i])
            indices_remaining.pop(index)
        
        if len(indices_remaining) > 0:
            # Order the remaining point indices by their average distances
            ordered_avgs, ordered_indices \
            = zip(*sorted(zip(average_distances, indices_remaining)))
            
            # Add point index to indices_activated
            indices_activated.append(ordered_indices[0])
            
            # Remove point index from indices_remaining
            ind = indices_remaining.index(ordered_indices[0])
            indices_remaining.pop(ind)
    
    return sorted(indices_activated)


# Among all possible sets of compact activated seating patterns,
# find those that feature the most number of seats,
# ordered by greatest average separation
def MaxSeating(points, threshold):
    # Matrix of distances between points, organized by index
    dist_matrix = DistanceMatrix(points)
    
    # List all solutions that have most number of seat activated
    largest_solutions = []
    mostSeats = 0
    for i in range(len(points)):
        #candidate = tuple(ActiveIndices_1(points, dist_matrix, threshold, i))
        candidate = tuple(ActiveIndices_2(points, dist_matrix, threshold, i))
        if len(candidate) >= mostSeats:
            largest_solutions.append(candidate)
            if len(candidate) > mostSeats: mostSeats = len(candidate)
    
    # Keep only solutions with the largest possible number of seats activated
    reduced_solutions = []
    for i in range(len(largest_solutions)):
        if len(largest_solutions[i]) == mostSeats:
            reduced_solutions.append(largest_solutions[i])
    
    # Remove duplicates
    unique_solutions = list(set(reduced_solutions))
    
    # Find average distance from each point in a solution to the group center
    center = PointAverage(points)
    avg_distances = []
    for i in range(len(unique_solutions)):
        avg = 0
        for j in range(len(unique_solutions[i])):
            avg += DistanceTo(points[unique_solutions[i][j]], center)
        avg_distances.append(avg/len(unique_solutions[i]))
    
    # Order solutions by their greatest average distance from the group center
    ordered_avgs, ordered_solutions \
    = zip(*sorted(zip(avg_distances, unique_solutions)))
    ordered_solutions_as_list = list(ordered_solutions)
    ordered_solutions_as_list.reverse()
    return ordered_solutions_as_list

# For a set of ordered integers and a total number (count) of expected
# integers, return those that are missing in the list (nums)
def FindMissing(nums, count):
	missing = []
	nums_index = 0
	for i in range(count):
		if nums_index < len(nums) and nums[nums_index] == i:
			nums_index += 1
		else:
			missing.append(i)
	return missing





# Inputs
elements = IN[0]
points = IN[1]
threshold = IN[2]

# Find max-occupied solutions for each group of points
indices_incl = []
indices_excl = []
if isinstance(points, list):
	# There are multiple groups of elements/points
	if isinstance(points[0], list):
		for i in range(len(points)):
			# Indices included
			indices_set = MaxSeating(points[i], threshold)
			indices_incl.append(indices_set)
			
			# Indices excluded
			indices_excl_set = []
			for j in range(len(indices_set)):
				indices_excl_set.append(FindMissing(indices_set[j], len(points[i])))
			indices_excl.append(indices_excl_set)
	# There is only a single group of elements/points
	else:
		# Indices included
		indices_set = MaxSeating(points, threshold)
		indices_incl.append(indices_set)
		
		# Indices excluded
		indices_excl_set = []
		for j in range(len(indices_set)):
			indices_excl_set.append(FindMissing(indices_set[j], len(points)))
		indices_excl.append(indices_excl_set)


"""
# Outputs
elements_incl = []
locations_incl = []

# Iterate through each group
for i in range(len(indices_incl)):
	elements_incl_group = []
	locations_incl_group = []

	# Iterate through each solution
	for j in range(len(indices_incl[i])):
		elements_incl_solution = []
		locations_incl_solution = []

		# Iterate through each element in each solution
		solution = list(indices_incl[i][j])
		for k in range(len(solution)):
			elements_incl_solution.append(elements[i][solution[k]])
			locations_incl_solution.append(points[i][solution[k]])

		elements_incl_group.append(elements_incl_solution)
		locations_incl_group.append(locations_incl_solution)
	
	elements_incl.append(elements_incl_group)
	locations_incl.append(locations_incl_group)
"""


OUT = []
#OUT.append(elements_incl)
#OUT.append(locations_incl)
OUT.append(indices_incl)
OUT.append(indices_excl)
# ----------------------------------------
code_block_23 = CodeBlock(OUT=python_script_2) { indices_incl = OUT[0]; indices_excl = OUT[1]; }
# note: First listed possible solution is the one with greatest average internal separation.
firstItem_3 = List.FirstItem(list=code_block_23.indices_incl@L3)
getItemAtIndex = List.GetItemAtIndex(list=code_block_21.locations@L2, index=firstItem_3@L2)
firstItem_4 = List.FirstItem(list=code_block_23.indices_excl@L3)
getItemAtIndex_2 = List.GetItemAtIndex(list=code_block_21.locations@L2, index=firstItem_4@L2)
code_block_24 = CodeBlock(locations_included=getItemAtIndex, locations_excluded=getItemAtIndex_2) { locations_included; locations_excluded; }
# note: Applying indices to lists of elements and their location points
getItemAtIndex_3 = List.GetItemAtIndex(list=code_block_21.seat_info@L2, index=firstItem_3@L2)
getItemAtIndex_4 = List.GetItemAtIndex(list=code_block_21.seat_info@L2, index=firstItem_4@L2)
code_block_25 = CodeBlock(elements_included=getItemAtIndex_3, elements_excluded=getItemAtIndex_4) { elements_included; elements_excluded; }

# group: Dynamo display occupied seats and excluded seats
code_block_26 = CodeBlock(locations_included=code_block_24.locations_included) { locations_included; }
code_block_27 = CodeBlock(threshold=minimum_separation_project_units)
# ---------- code_block_27.designscript (5 lines) ----------
// Exclusion zone radius
threshold/2;

// Radius of seat marker
seatRad = 1;
# ----------------------------------------
byCenterPointRadius = Circle.ByCenterPointRadius(centerPoint=code_block_26, radius=code_block_27.seatRad)
color_palette = ColorPalette({R: 0, G: 0, B: 255, A: 255})
byGeometryColor = Modifiers.GeometryColor.ByGeometryColor(geometry=byCenterPointRadius, color=color_palette)
byCenterPointRadius_2 = Circle.ByCenterPointRadius(centerPoint=code_block_26, radius=code_block_27.out0)
color_palette_2 = ColorPalette({R: 0, G: 0, B: 255, A: 255})
byGeometryColor_2 = Modifiers.GeometryColor.ByGeometryColor(geometry=byCenterPointRadius_2, color=color_palette_2)
code_block_28 = CodeBlock(locations_excluded=code_block_24.locations_excluded) { locations_excluded; }
code_block_29 = CodeBlock(loc=code_block_28, seatRad=code_block_27.seatRad)
# ---------- code_block_29.designscript (12 lines) ----------
DrawX(loc, seatRad);

// Draw an "X" at a point
def DrawX(pt : Point, rad : var)
{
	vec = Vector.ByCoordinates(rad,0,0);
	vecs = vec.Rotate(Vector.ZAxis(),[45,135,225,315]);
	pts = pt.Translate(vecs);
	line1 = Line.ByStartPointEndPoint(pts[0],pts[2]);
	line2 = Line.ByStartPointEndPoint(pts[1],pts[3]);
	return = [line1,line2];
};
# ----------------------------------------
color_palette_3 = ColorPalette({R: 210, G: 105, B: 30, A: 255})
byGeometryColor_3 = Modifiers.GeometryColor.ByGeometryColor(geometry=code_block_29, color=color_palette_3)

# group: Override color
output_as_override_element_color = BoolSelector(false)  # graph input

# group: Revit: override color of elements in view
code_block_30 = CodeBlock(elements_included=code_block_25.elements_included, elements_excluded=code_block_25.elements_excluded) { elements_included; elements_excluded; }
code_block_31 = CodeBlock(test=output_as_override_element_color, elements=code_block_30.elements_included) { test; elements; }
python_script_3 = Python(IN[0]=code_block_31.test, IN[1]=code_block_31.elements)
# ---------- python_script_3.python (8 lines) ----------
import sys
import clr

test = IN[0]
elements = IN[1]

OUT = []
if test: OUT = elements
# ----------------------------------------
color_palette_4 = ColorPalette({R: 124, G: 252, B: 0, A: 255})
overrideColorInView = Element.OverrideColorInView(element=python_script_3, color=color_palette_4)
code_block_32 = CodeBlock(test=output_as_override_element_color, elements=code_block_30.elements_excluded) { test; elements; }
python_script_4 = Python(IN[0]=code_block_32.test, IN[1]=code_block_32.elements)  # same code as python_script_3
color_palette_5 = ColorPalette({R: 210, G: 105, B: 30, A: 255})
overrideColorInView_2 = Element.OverrideColorInView(element=python_script_4, color=color_palette_5)

# group: Update parameter
output_as_y_n_parameter = BoolSelector(false)  # graph input
y_n_parameter_name = StringInput("Occupied")  # graph input

# group: Revit: update Yes/No parameter per seat element
code_block_33 = CodeBlock(elements_included=code_block_25.elements_included, elements_excluded=code_block_25.elements_excluded) { List.Flatten(elements_included); List.Flatten(elements_excluded); }
code_block_34 = CodeBlock(test=output_as_y_n_parameter, elements=code_block_33.out0) { test; elements; }
python_script_5 = Python(IN[0]=code_block_34.test, IN[1]=code_block_34.elements)  # same code as python_script_3
code_block_35 = CodeBlock { true; }
setParameterByName = Element.SetParameterByName(element=python_script_5, parameterName=y_n_parameter_name, value=code_block_35)
code_block_36 = CodeBlock(test=output_as_y_n_parameter, elements=code_block_33.out1) { test; elements; }
python_script_6 = Python(IN[0]=code_block_36.test, IN[1]=code_block_36.elements)  # same code as python_script_3
code_block_37 = CodeBlock { false; }
setParameterByName_2 = Element.SetParameterByName(element=python_script_6, parameterName=y_n_parameter_name, value=code_block_37)

# group: Metric: Occupancy
code_block_38 = CodeBlock(elements_included=code_block_25.elements_included, elements_excluded=code_block_25.elements_excluded) { elements_included; elements_excluded; }
flatten = List.Flatten(list=code_block_38.elements_included)
count = List.Count(list=flatten)
flatten_2 = List.Flatten(list=code_block_38.elements_excluded)
count_2 = List.Count(list=flatten_2)
code_block_39 = CodeBlock(num_incl=count, num_excl=count_2) { total = num_incl + num_excl; Math.Round(100 * num_incl/total, 1); }
total_seats = Watch(code_block_39.total)  # graph output
occupied_seats = Watch(count)  # graph output
percent_occupied = Watch(code_block_39.out1)  # graph output
