# Dynamo graph cuboid.dyn (Dynamo 0.6.2.42463)

number = DoubleInput(0)
point = Point3DNode(number, number, number, lacing=Longest)
number_2 = DoubleInput(1)
vector = VectorNode(number_2, number, number, lacing=Longest)
vector_2 = VectorNode(number, number_2, number, lacing=Longest)
coordinateSystem = CoordinateSystemNode(point, vector, vector_2, lacing=Longest)
number_3 = DoubleInput(2)
cuboid = CuboidNode(coordinateSystem, number_3, number_3, number_3, lacing=Longest)
