# Dynamo graph Dynamic Relaxation Loop .dyf "Dynamic Relaxation Loop"
# category: Miscellaneous

ps = Input()
number = DoubleInput(1)
pause = Pause(number)
dynamic_relaxation_step = DynamicRelaxationStep(ps, pause)
transaction = Transaction(dynamic_relaxation_step)
Dynamic_Relaxation_Loop = Output(ps)
perform_all = Begin(expr1=transaction, expr2=pause, expr3=Dynamic_Relaxation_Loop)
