# Dynamo graph Dynamic Relaxation Loop Counter.dyf
# category: Miscellaneous

ps = Input()
number = DoubleInput(1)
pause = Pause(number)
dynamic_relaxation_step = DynamicRelaxationStep(ps, pause)
transaction = Transaction(dynamic_relaxation_step)
Dynamic_Relaxation_Loop = Output(ps)
counter = Input()
max = Input()
gt = GreaterThan(counter, max)
number_2 = DoubleInput(1)
add = Addition(counter, number_2)
debug_breakpoint = Breakpoint(add)
if_ = Conditional(gt, debug_breakpoint)
perform_all = Begin(expr1=transaction, expr2=pause, expr3=Dynamic_Relaxation_Loop, expr4=if_)
