# Dynamo graph Relaxation Engine.dyf
# category: Miscellaneous

points = Input()
curves = Input()
number = DoubleInput(10)
number_slider = DoubleSliderInput(0.5666666667, range=0..1)
number_slider_2 = DoubleSliderInput(800, range=0..800)
number_slider_3 = DoubleSliderInput(10, range=0..10)
dynamic_relaxation = DynamicRelaxation(points, curves, number, number_slider, number_slider_2, number_slider_3)
transaction = Transaction(dynamic_relaxation)
pause = Pause(number)
Relaxation_Engine = Output(points, curves)
perform_all = Begin(expr1=transaction, expr2=pause, expr3=Relaxation_Engine)
