# Dynamo graph actually works instance params.dyn

number = DoubleInput(100)
family_instance_by_selection = FamilyInstanceCreatorSelection()  # 1 picked in the model
string = StringInput("a")
number_2 = DoubleInput(23)
set_instance_parameter = FamilyInstanceParameterSetter(family_instance_by_selection, string, number_2)
Family_Curve_Loop = Output(number, set_instance_parameter)
number_3 = DoubleInput(0)
family_instance_by_selection_2 = FamilyInstanceCreatorSelection()  # 1 picked in the model
Family_Curve_Loop_2 = Output(number_3, family_instance_by_selection_2)  # "Family Curve Loop"
list = NewList(item_s=Family_Curve_Loop, index1=Family_Curve_Loop_2)
watch = Watch(list)
boolean = BoolSelector(true)
boolean_2 = BoolSelector(false)
loft_form = LoftForm(boolean, list, boolean_2)
string_2 = StringInput("")
