# Dynamo graph actually works more in family.dyn

number = DoubleInput(100)
family_instance_by_selection = FamilyInstanceCreatorSelection()  # 1 picked in the model
Family_Curve_Loop = Output(number, family_instance_by_selection)
number_2 = DoubleInput(0)
family_instance_by_selection_2 = FamilyInstanceCreatorSelection()  # 1 picked in the model
Family_Curve_Loop_2 = Output(number_2, family_instance_by_selection_2)  # "Family Curve Loop"
list = NewList(index0=Family_Curve_Loop, index1=Family_Curve_Loop_2)
watch = Watch(list)
boolean = BoolSelector(true)
boolean_2 = BoolSelector(false)
loft_form = LoftForm(boolean, list, boolean_2)
number_3 = DoubleInput(0)
