# Dynamo graph array.dyf "GraphFunction"
# category: Revit

number = DoubleInput(0)
x_start = Input()  # "x-start"
x_end = Input()  # "x-end"
x_step = Input()  # "x-step"
build_sequence = BuildSeq(x_start, x_end, x_step)
add = Addition()
map = Map(add, build_sequence)
combine = Combine(number, build_sequence, map)
