# Dynamo graph cbp with Relaxation Engine.dyn

number = DoubleInput(200)
boolean = BoolSelector(false)
timer = Timer(number, boolean)
number_slider = DoubleSliderInput(0.667501043, range=0..1)
number_slider_2 = DoubleSliderInput(800, range=0..800)
number_slider_3 = DoubleSliderInput(10, range=0..10)
number_slider_4 = DoubleSliderInput(22.23696287, range=0..50)
number_2 = DoubleInput(-1)
π = Pi()
multiplication = Multiplication(number_2, π)
multiplication_2 = Multiplication(number_slider_4, multiplication)
multiplication_3 = Multiplication(π, number_slider_4)
number_3 = DoubleInput(32)
division = Division(π, number_3)
multiplication_4 = Multiplication(number_slider_4, division)
number_slider_5 = DoubleSliderInput(5.171881519, range=0..10)
multiplication_5 = Multiplication(number_slider_4, number_slider_5)
number_4 = DoubleInput(1)
division_2 = Division(number_4, number_slider_4)
sine = Sin()
C_f_dx = Output(multiplication_5, division_2, sine)  # "C*f(dx)"
GraphFunction = Output(multiplication_2, multiplication_3, multiplication_4, C_f_dx)
reference_point = ReferencePointByXYZ(GraphFunction)
transaction = Transaction(reference_point)
ConnectPoints = Output(reference_point)
transaction_2 = Transaction(ConnectPoints)
Relaxation_Engine = Output(transaction, transaction_2)
