# Dynamo graph cbp2.dyn

number_slider = DoubleSliderInput(22.23696287, range=0..50)
number = DoubleInput(-1)
π = Pi()
multiplication = Multiplication(number, π)
multiplication_2 = Multiplication(number_slider, multiplication)
multiplication_3 = Multiplication(π, number_slider)
number_2 = DoubleInput(32)
division = Division(π, number_2)
multiplication_4 = Multiplication(number_slider, division)
number_slider_2 = DoubleSliderInput(5.171881519, range=0..10)
multiplication_5 = Multiplication(number_slider, number_slider_2)
number_3 = DoubleInput(1)
division_2 = Division(number_3, number_slider)
sine = Sin()
C_f_dx = Output(multiplication_5, division_2, sine)  # "C*f(dx)"
GraphFunction = Output(multiplication_2, multiplication_3, multiplication_4, C_f_dx)
reference_point = ReferencePointByXYZ(GraphFunction)
ConnectPoints = Output(reference_point)
number_4 = DoubleInput(200)
boolean = BoolSelector(false)
timer = Timer(number_4, boolean)
number_slider_3 = DoubleSliderInput(0.667501043, range=0..1)
number_slider_4 = DoubleSliderInput(800, range=0..800)
number_slider_5 = DoubleSliderInput(10, range=0..10)
dynamic_relaxation = DynamicRelaxation(reference_point, ConnectPoints, timer, number_slider_3, number_slider_4, number_slider_5)
