# Dynamo graph dynamic relaxation 4.dyn

point_by_selection = PointBySelection()  # 1 picked in the model
point_by_selection_2 = PointBySelection()  # 1 picked in the model
list = NewList(item_s=point_by_selection, index1=point_by_selection_2)
curve_by_points = CurveByPoints(list)
number = DoubleInput(1)
boolean = BoolSelector(false)
timer = Timer(number, boolean)
number_slider = DoubleSliderInput(1, range=0..1)
number_slider_2 = DoubleSliderInput(800, range=0..800)
# note: 1, 800, 0.8); //  double restLength, double springConstant, double damping)
number_slider_3 = DoubleSliderInput(10, range=0..10)
dynamic_relaxation = DynamicRelaxation(list, curve_by_points, timer, number_slider, number_slider_2, number_slider_3)
