# Dynamo graph slope of a line 1.dyn

number = DoubleInput(-1)
number_slider = DoubleSliderInput(120, range=0..300)
multiplication = Multiplication(number, number_slider)
number_2 = DoubleInput(10)
division = Division(number_slider, number_2)
number_slider_2 = DoubleSliderInput(23.33333333, range=0..100)
number_slider_3 = DoubleSliderInput(4, range=0..10)
y = Output(number_slider_2, number_slider_3)  # "y=Mx+b"
GraphFunction = Output(multiplication, number_slider, division, y)
reference_point = ReferencePointByXYZ(GraphFunction)
ConnectPoints = Output(reference_point)
number_3 = DoubleInput(1)
number_4 = DoubleInput(1)
number_5 = DoubleInput(800)
number_6 = DoubleInput(1)
create_particle_system = DynamicRelaxation(reference_point, ConnectPoints, number_3, number_4, number_5, number_6)
Dynamic_Relaxation_Loop = Output()
