# Dynamo graph slope of a line.dyn

number = DoubleInput(-1)
number_slider = DoubleSliderInput(300, range=0..300)
multiplication = Multiplication(number, number_slider)
number_2 = DoubleInput(10)
division = Division(number_slider, number_2)
number_slider_2 = DoubleSliderInput(23.33333333, range=0..100)
number_slider_3 = DoubleSliderInput(4, range=0..10)
y = Output(number_slider_2, number_slider_3)  # "y=Mx+b"
GraphFunction = Output(multiplication, number_slider, division, y)
reference_point = ReferencePointByXYZ(GraphFunction)
ConnectPoints = Output(reference_point)
