# Dynamo graph create point - end.dyn

number = DoubleInput(0)
number_2 = DoubleInput(0)
number_slider = DoubleSliderInput(0, range=0..100)
XYZ = XYZ(number, number_2, number_slider, lacing=Longest)
reference_point = ReferencePointByXYZ(XYZ, lacing=Longest)
