# Dynamo graph create point_sequence.dyn

number = DoubleInput(0)
number_slider = DoubleSliderInput(72.78976819, range=0..100)
number_2 = DoubleInput(10)
number_range = NumberRange(number, number_slider, number_2, lacing=Longest)
XYZ = XYZ(number, number, number_range, lacing=Longest)
reference_point = ReferencePointByXYZ(XYZ, lacing=Longest)
