# Dynamo graph ref grid sliders - end.dyn

number_slider = DoubleSliderInput(5.95505618, range=0..10)
number = DoubleInput(1)
number_2 = DoubleInput(0)
number_slider_2 = DoubleSliderInput(30, range=0..50)
number_slider_3 = DoubleSliderInput(19, range=0..50)
number_3 = DoubleInput(0)
xyz_grid = ReferencePtGrid(number_slider, number_slider, number, number_2, number_2, number_2, number_slider_2, number_slider_3, number_3)
select_fam = FamilyTypeSelector(index=5)
create_fam_inst = FamilyInstanceCreatorXYZ(xyz_grid, select_fam, lacing=Longest)
