# Dynamo graph divide selected curve - end.dyn

number = DoubleInput(21)
select_curve = CurvesBySelection()
number_slider = DoubleSliderInput(33.33333333, range=0..100)
xyz_array_on_curve = XYZArrayAlongCurve(select_curve, number_slider)
ref_point = ReferencePointByXYZ(xyz_array_on_curve, lacing=Longest)
