# Dynamo graph form from curve selection - list.dyn

boolean = BoolSelector(true)
select_curve = CurvesBySelection()
curve_reference = CurveRef(select_curve)
list = NewList(item_s=curve_reference)
select_curve_2 = CurvesBySelection()
curve_reference_2 = CurveRef(select_curve_2)
list_2 = NewList(item_s=curve_reference_2)
list_3 = NewList(item_s=list, index1=list_2)
boolean_2 = BoolSelector(true)
loft_form = LoftForm(boolean, list_3, boolean_2)
