# Dynamo graph connect two point arrays.dyn

curve_by_selection = CurvesBySelection()  # 1 picked in the model
number_slider = DoubleSliderInput(18.25967797, range=0..20)
xyz_array_along_curve = XyzArrayAlongCurve(curve_by_selection, number_slider)
ref_point = ReferencePointByXyz(xyz_array_along_curve, lacing=Longest)
curve_by_selection_2 = CurvesBySelection()  # 1 picked in the model
xyz_array_along_curve_2 = XyzArrayAlongCurve(curve_by_selection_2, number_slider)
ref_point_2 = ReferencePointByXyz(xyz_array_along_curve_2, lacing=Longest)
list = NewList(index0=ref_point, index1=ref_point_2, index2=number_slider)
watch = Watch(list)
python_script = Python(list)
# ---------- python_script.python (36 lines) ----------
# Default imports
import clr
clr.AddReference('RevitAPI')
clr.AddReference('RevitAPIUI')
from Autodesk.Revit.DB import *
import Autodesk
import sys
import clr
path = r'C:\Autodesk\Dynamo\Core'
exec_path = r'C:\Users\Ian\Documents\GitHub\Dynamo\bin\AnyCPU\Debug'
sys.path.append(path)
sys.path.append(exec_path)
clr.AddReference('LibGNet')
from Autodesk.LibG import *
import math

doc = __revit__.ActiveUIDocument.Document
app = __revit__.Application

RefPointList1 = IN[0]
RefPointList2 = IN[1]
count = IN[2] 

max = int(count)

#use for loop to connect two series of points
#if count > len(RefPointList1):
max = len(RefPointList1)

for i in range(0,max):
    pt1 = RefPointList1[i]
    pt2 = RefPointList2[i]
    refptarr = ReferencePointArray()
    refptarr.Append(pt1)
    refptarr.Append(pt2)
    crv = doc.FamilyCreate.NewCurveByPoints(refptarr)
# ----------------------------------------
