# Dynamo graph solar radiation optimizer.dyn
# Copyright Autodesk, Inc. 2012. All rights reserved.
# Licensed under the Apache License, Version 2.0 (the "License");
# you may not use this file except in compliance with the License.
# You may obtain a copy of the License at
# http://www.apache.org/licenses/LICENSE-2.0
# Unless required by applicable law or agreed to in writing, software
# distributed under the License is distributed on an "AS IS" BASIS,
# WITHOUT WARRANTIES OR CONDITIONS OF ANY KIND, either express or implied.
# See the License for the specific language governing permissions and
# limitations under the License.

family_instance_selection = FamilyInstanceCreatorSelection()
string = StringInput("increment")
number = DoubleInput(1)
number_2 = DoubleInput(36)
filename = StringFilename("C:\Users\t_ellist\Desktop\solar.csv")
solar_radiation_optimizer = Function(family_instance_selection, string, number, number_2, filename)
