# Dynamo graph inst param 2 masses.dyn

select_family_instance = FamilyInstanceCreatorSelection()  # 1 picked in the model
select_fam_inst_param = FamilyInstanceParameterSelector(select_family_instance)
number_slider = DoubleSliderInput(40, range=0..100)
set_instance_parameter = FamilyInstanceParameterSetter(select_family_instance, select_fam_inst_param, number_slider, lacing=Longest)
get_instance_parameter = FamilyInstanceParameterGetter(set_instance_parameter, select_fam_inst_param, lacing=Longest)
watch = Watch(get_instance_parameter)
select_family_instance_2 = FamilyInstanceCreatorSelection()  # 1 picked in the model
set_instance_parameter_2 = FamilyInstanceParameterSetter(select_family_instance_2, select_fam_inst_param, number_slider, lacing=Longest)
