# Dynamo graph DynamicMobius.dyn

filename = StringFilename("C:\Autodesk\Dynamo\Core\samples\09 Dynamic Python Editing\01-RPS-Mobius.py")
read_file = FileReader(filename)
number_slider = DoubleSliderInput(2.730337079, range=0..3)
python_script_from_string = PythonString(read_file, number_slider)
transaction = Transaction(python_script_from_string)
watch = Watch(python_script_from_string)
