# Dynamo graph Indexed Family Instances.dyn

xyz_zero = XYZZero(lacing=Longest)
number = DoubleInput(1)
number_slider = DoubleSliderInput(20, range=0..20)
number_2 = DoubleInput(1)
number_sequence = BuildSeq(number, number_slider, number_2, lacing=Longest)
list_length = Length(number_sequence)
repeat = Repeat(xyz_zero, list_length, lacing=Longest)
family_type_selector = FamilyTypeSelector(index=4)
create_family_instance = FamilyInstanceCreatorXYZ(repeat, family_type_selector, lacing=Longest)
string = StringInput("increment")
set_family_instance_parameter = FamilyInstanceParameterSetter(create_family_instance, string, number_sequence, lacing=Longest)
