# Dynamo graph arduino two inputs.dyn

take = TakeList()
number = DoubleInput(1)
string_number = String2Num()
number_2 = DoubleInput(25)
execution_interval = ExecuteInterval(number_2)
arduino = Arduino(execution_interval)
watch = Watch(arduino)
string = StringInput("%7c")
split_string = SplitString(watch, string)
map = Map(string_number, split_string)
watch_2 = Watch(map)
get = GetFromList(number, watch_2)
watch_3 = Watch(get)
number_3 = DoubleInput(0)
get_2 = GetFromList(number_3, watch_2)
watch_4 = Watch(get_2)
