# Dynamo graph arduino write.dyn

number = DoubleInput(10)
execution_interval = ExecuteInterval(number)
arduino = Arduino(execution_interval)
read_arduino = ArduinoRead(arduino)
watch = Watch(read_arduino)
string = StringInput("%22Hi+from+Dynamo%22")
write_arduino = ArduinoWrite(arduino, string)
watch_2 = Watch(write_arduino)
