# Dynamo graph udp listener.dyn

number = DoubleInput(10)
execution_interval = ExecuteInterval(number)
number_2 = DoubleInput(11000)
udp_listener = UDPListener(execution_interval, number_2)
watch = Watch(udp_listener)
