# Dynamo graph web request.dyn

number = DoubleInput(11000)
udp_listener = UDPListener(arg1=number)
number_2 = DoubleInput(10)
execution_interval = ExecuteInterval(number_2)
string = StringInput("http%3a%2f%2fgoogle.com")
web_request = WebRequest(string)
watch = Watch(web_request)
