# Dynamo graph Arc and Line from Ref Points.dyn

point_by_selection = PointBySelection()  # 1 picked in the model
point_by_selection_2 = PointBySelection()  # 1 picked in the model
line = LineBound(point_by_selection, point_by_selection_2)
new_sketch_plane = Function()
model_curve = ModelCurve(line, new_sketch_plane)
point_by_selection_3 = PointBySelection()  # 1 picked in the model
line_2 = LineBound(point_by_selection_2, point_by_selection_3)
model_curve_2 = ModelCurve(line_2, new_sketch_plane)
arc_by_start_middle_end = ArcStartMiddleEnd(point_by_selection, point_by_selection_3, point_by_selection_2)
model_curve_3 = ModelCurve(arc_by_start_middle_end, new_sketch_plane)
number_slider = DoubleSliderInput(87.18181818, range=0..100)
number_slider_2 = DoubleSliderInput(5.2, range=0..6.2)
number_slider_3 = DoubleSliderInput(0.9163636364, range=0..6.2)
arc_by_center_point = ArcCenter(point_by_selection_2, number_slider, number_slider_2, number_slider_3)
model_curve_4 = ModelCurve(arc_by_center_point, new_sketch_plane)
