# Dynamo graph all curve test.dyn

planar_nurb_spline = ModelCurveNurbSpline(lacing=Longest)
boolean = BoolSelector(false)
curve_by_points = CurveByPoints(arg1=boolean, lacing=Longest)
curve_by_points_by_line = CurveByPointsByLine(lacing=Longest)
π = Pi()
watch = Watch()
point_by_selection = PointBySelection()
xyz_from_ref_point = XYZFromReferencePoint(point_by_selection, lacing=Longest)
number_slider = DoubleSliderInput(65.54545455, range=0..100)
number_slider_2 = DoubleSliderInput(0, range=0..6.2)
number_slider_3 = DoubleSliderInput(4.283636364, range=0..6.2)
arc_by_center_point = ArcCenter(xyz_from_ref_point, number_slider, number_slider_2, number_slider_3, lacing=Longest)
xyz_from_ref_point_2 = XYZFromReferencePoint(point_by_selection, lacing=Longest)
point_by_selection_2 = PointBySelection()
xyz_from_ref_point_3 = XYZFromReferencePoint(point_by_selection_2, lacing=Longest)
point_by_selection_3 = PointBySelection()
xyz_from_ref_point_4 = XYZFromReferencePoint(point_by_selection_3, lacing=Longest)
arc_by_start_middle_end = ArcStartMiddleEnd(xyz_from_ref_point_2, xyz_from_ref_point_3, xyz_from_ref_point_4, lacing=Longest)
xyz_from_ref_point_5 = XYZFromReferencePoint(point_by_selection_3, lacing=Longest)
circle = Circle(xyz_from_ref_point_5, number_slider, lacing=Longest)
point_by_selection_4 = PointBySelection()
xyz_from_ref_point_6 = XYZFromReferencePoint(point_by_selection_4, lacing=Longest)
number = DoubleInput(2)
division = Division(number_slider, number, lacing=Longest)
elliptical_arc = EllipticalArc(xyz_from_ref_point_6, number_slider, division, number_slider_2, number_slider_3, lacing=Longest)
point_by_selection_5 = PointBySelection()
xyz_from_ref_point_7 = XYZFromReferencePoint(point_by_selection_5, lacing=Longest)
ellipse = Ellipse(xyz_from_ref_point_7, division, number_slider, lacing=Longest)
list = NewList(index0=arc_by_center_point, index1=arc_by_start_middle_end, index2=circle, index3=elliptical_arc, index4=ellipse)
watch_3d = Watch3D(list)
xyz_zero = XYZZero(lacing=Longest)
number_2 = DoubleInput(3.142)
number_3 = DoubleInput(6.283)
