# Dynamo graph ellipse.dyn

number_slider = DoubleSliderInput(0, range=0..100)
number = DoubleInput(0)
XYZ = XYZ(number_slider, number, number, lacing=Longest)
number_slider_2 = DoubleSliderInput(30.90909091, range=0..200)
number_slider_3 = DoubleSliderInput(200, range=0..200)
ellipse = Ellipse(XYZ, number_slider_2, number_slider_3, lacing=Longest)
z_axis = XYZBasisZ(lacing=Longest)
plane = Plane(z_axis, XYZ, lacing=Longest)
sketch_plane = SketchPlane(plane, lacing=Longest)
model_curve = ModelCurve(ellipse, sketch_plane, lacing=Longest)
select_curve = CurvesBySelection()
curve_from_curve_element = CurveFromModelCurve(select_curve, lacing=Longest)
list = NewList(item_s=ellipse, index1=curve_from_curve_element)
watch_3d = Watch3D(list)
