# Dynamo graph Excel to Stuff.dyn

get_worksheets_from_excel = GetWorksheetsFromExcelWorkbook()
write_data_to_excel_worksheet = WriteDataToExcelWorksheet()
add_excel_worksheet_to_workbook = AddExcelWorksheetToWorkbook()
new_excel_workbook = NewExcelWorkbook()
save_excel_workbook_as = SaveAsExcelWorkbook()
file_path = StringFilename("C:\Users\kronz\Documents\GitHub\Dynamo\doc\distrib\Samples\15 Spreadsheets\helix.xlsx")
open_excel_workbook = ReadExcelFile(file_path)
string = StringInput("helix")
get_excel_worksheet_by_name = GetExcelWorksheetByName(open_excel_workbook, string)
get_data_from_excel_worksheet = GetDataFromExcelWorksheet(get_excel_worksheet_by_name)
watch = Watch(get_data_from_excel_worksheet)
transpose_lists = Transpose(get_data_from_excel_worksheet)
watch_2 = Watch(transpose_lists)
number = DoubleInput(0)
get_from_list = GetFromList(number, transpose_lists)
number_2 = DoubleInput(1)
get_from_list_2 = GetFromList(number_2, transpose_lists)
number_3 = DoubleInput(2)
get_from_list_3 = GetFromList(number_3, transpose_lists)
XYZ = XYZ(get_from_list, get_from_list_2, get_from_list_3, lacing=Longest)
watch_3d = Watch3D(XYZ)
watch_3 = Watch(get_from_list)
