# Dynamo graph tesselation with coincident grids.dyn

select_face = FormElementBySelection()  # 1 picked in the model
surface_domain = SurfaceDomain(select_face)
number_slider = DoubleSliderInput(11.27946128, range=0..20)
uv_grid = UVGrid(surface_domain, number_slider, number_slider)
evaluate_uv = XYZEvaluate(uv_grid, select_face, lacing=Longest)
# note: Wiggle Sliders
# for Awesome
number_slider_2 = DoubleSliderInput(6.515151515, range=0..20)
uv_grid_2 = UVGrid(surface_domain, number_slider_2, number_slider_2)
append = Append(uv_grid_2, uv_grid)
voronoi_on_face = VoronoiOnFace(append, select_face, lacing=Longest)
list = NewList(index0=evaluate_uv, index1=voronoi_on_face)
watch_3d = Watch3D(list)
curve_by_points_by_line = CurveByPointsByLine()
