# Dynamo graph tesselation.dyn

# note: Connect these to
# make Revit Stuff
# note: Swap these connections
# For different patterning

select_face = FormElementBySelection()  # 1 picked in the model
surface_domain = SurfaceDomain(select_face)
number_slider = DoubleSliderInput(13.98071625, range=0..40)
uv_random = UVRandom(surface_domain, number_slider, number_slider)
voronoi_on_face = VoronoiOnFace(uv_random, select_face, lacing=Longest)
watch_3d = Watch3D(voronoi_on_face)
uv_grid = UVGrid(surface_domain, number_slider, number_slider)
curve_by_points_by_line = CurveByPointsByLine(lacing=Longest)
