# Dynamo graph tesselation_types.dyn

select_face = FormElementBySelection()  # 1 picked in the model
surface_domain = SurfaceDomain(select_face)
number_slider = DoubleSliderInput(6.816537149, range=0..40)
uv_random = UVRandom(surface_domain, number_slider, number_slider)
voronoi_on_face = VoronoiOnFace(uv_random, select_face, lacing=Longest)
watch_3d = Watch3D(voronoi_on_face)
delaunay_on_face = DelaunayOnFace(uv_random, select_face, lacing=Longest)
watch_3d_2 = Watch3D(delaunay_on_face)
evaluate_uv = XYZEvaluate(uv_random, select_face, lacing=Longest)
convex_hull_3d = ConvexHull3d(evaluate_uv, lacing=Longest)
# note: Swap these connections
# For different patterning
watch_3d_3 = Watch3D(convex_hull_3d)
delaunay_3d = Delaunay3d(evaluate_uv, lacing=Longest)
watch_3d_4 = Watch3D(delaunay_3d)
