# Dynamo graph Translate and Rotate sequence.dyn

xyz_zero = XYZZero()
xyz_basisz = XYZBasisZ()
number = DoubleInput(0.1)
number_slider = DoubleSliderInput(6.24, range=0..6.24)
number_2 = DoubleInput(0.25)
number_sequence = BuildSeq(number, number_slider, number_2)
transform_rotation = TransformRotation(xyz_zero, xyz_basisz, number_sequence, lacing=Longest)
xyz_basisx = XYZBasisX()
xyz_scale = XYZScale(xyz_basisx, number_sequence, lacing=Longest)
transform_point = TransformPoint(transform_rotation, xyz_scale, lacing=Longest)
line = LineBound(xyz_zero, transform_point, lacing=Longest)
watch_3d = Watch3D(line)
curve_by_points_by_line = CurveByPointsByLine(lacing=Longest)
