# Dynamo custom node fibonacci.dyf
# category: Logic.Math

ListLength = Input()
number = DoubleInput(1)
subtract = Subtraction(ListLength, number)
number_2 = DoubleInput(0)
less_than = LessThan(subtract, number_2)
empty_list = Empty()
Start = Input()
list = NewList(index0=Start)
Next = Input()
add = Addition(Start, Next)
append_to_list = Append(list, add)
if_ = Conditional(less_than, empty_list, append_to_list)
