# Dynamo graph DynamoOnboardingGuide_HouseCreationDS.dyn (Dynamo 2.15.0.4767)

# group: Inputs
# Change the house width, height and length with these input sliders
width = IntegerSlider(10, range=5..20 step 1)
height = IntegerSlider(13, range=10..30 step 1)
length = DoubleSlider(23.5, range=10..40 step 0.5)

# group: Houses > Create House
create_house_profile_and_extrude = CodeBlock(width=width, height=height, length=length)  # "Create House Profile and Extrude into Shape"
# ---------- create_house_profile_and_extrude.designscript (11 lines) ----------
//Create points that define the house profile
floorA = Point.ByCoordinates(-width/2,0,0);
floorB = Point.ByCoordinates(width/2,0,0);
ceilingA = Point.ByCoordinates(-width/2,0,height/2);
ceilingB = Point.ByCoordinates(width/2,0,height/2);
apex = Point.ByCoordinates(0,0,height);
//Creating a closed profile using our points
profile = PolyCurve.ByPoints([floorA,ceilingA,apex,ceilingB,floorB],true);
//Creating an extrusion using our profile
surface = Surface.ByPatch(profile);
extrude = Surface.Thicken(surface,length);
# ----------------------------------------
code_block = CodeBlock(singleHouse=create_house_profile_and_extrude.extrude)
# ---------- code_block.designscript (4 lines) ----------
color = Color.ByARGB(255,255,255,0);
house = GeometryColor.ByGeometryColor
	(singleHouse,
	color);
# ----------------------------------------

# group: Houses > Multiply Houses
create_coordinate_system = CodeBlock(width=width)  # "Create Coordinate System locations"
# ---------- create_coordinate_system.designscript (5 lines) ----------
//Defining the distance and amount
distance = (width*3)+2;
amount = width/3;
//Creating a number range
-distance..distance..#amount;
# ----------------------------------------

# group: Houses
# Create houses and transform them across our grid
byOrigin = CoordinateSystem.ByOrigin()
byOrigin_2 = CoordinateSystem.ByOrigin(x=create_coordinate_system.out2, y=create_coordinate_system.out2, lacing=CrossProduct)
transform = Geometry.Transform(geometry=create_house_profile_and_extrude.extrude, contextCoordinateSystem=byOrigin_2)  # unwired: fromCoordinateSystem
flatten = List.Flatten(list=transform)

# group: Color > Color Values
# Create color values for color range
create_color_values = CodeBlock(houses=flatten)
# ---------- create_color_values.designscript (4 lines) ----------
/*Creating color values between
zero (start) and one (end), to the
total count of our houses*/
value = 0..1..#List.Count(houses);
# ----------------------------------------

# group: Color
# Distinguish the houses with a color range
# note: We do not need colors or indices here as there are default values applied
color_range = ColorRange(value=create_color_values)  # unwired: colors, indices
byGeometryColor = Modifiers.GeometryColor.ByGeometryColor(geometry=flatten, color=color_range)
