# Dynamo graph HelloDynamoSystemTest.dyn (Dynamo 0.7.4.3157)

code_block = CodeBlock { "The answer."; }
hello_dynamo = HelloDynamo(code_block, lacing=CrossProduct)
watch = Watch(hello_dynamo.out0)
watch_2 = Watch(hello_dynamo.out1)
