# Dynamo graph CustCrash.dyn (Dynamo 0.9.1.3264)

# note: Break apart the polyCurves because we only want to send line segments to Revit.

number_slider = DoubleSlider(27.191, range=10..40 step 0.1)
byCoordinates = Point.ByCoordinates(y=number_slider)
makeATruss = Custom[MakeATruss]()  # makes lines for a truss from a base curve
