# Dynamo custom node CustomNodeForPublish.dyf (Dynamo 0.8.2.1943)
# category: Tests
# Custom node used for dynamo publish tests

a = Input()
number = DoubleInput(2)
mul = a * number
a_2 = Output(mul)  # "a"
