# Dynamo custom node CustomNodeForPublish2.dyf (Dynamo 0.8.2.1943)
# category: Tests
# Custom node used for publish tests

a = Input()
customNodeForPublish = Custom[CustomNodeForPublish](a=a)  # Custom node used for dynamo publish tests
customNodeForPublish_2 = Custom[CustomNodeForPublish](a=customNodeForPublish)
a_2 = Output(customNodeForPublish_2)  # "a"
