# Dynamo graph PointAnalysisDisplay_ByViewAndPointAnalysisData.dyn (Dynamo 0.7.2.16020)

views = Views("{3D}")
# note: Select two surfaces.
select_face = DSFaceSelection()  # 1 picked in the model
code_block = CodeBlock { 0..1..0.05; }
pointAtParameter = Surface.PointAtParameter(select_face, code_block, code_block, lacing=CrossProduct)
flatten = Flatten(pointAtParameter)
select_face_2 = DSFaceSelection()  # 1 picked in the model
pointAtParameter_2 = Surface.PointAtParameter(select_face_2, code_block, code_block, lacing=CrossProduct)
flatten_2 = Flatten(pointAtParameter_2)
join = List.Join(flatten, flatten_2)
number = DoubleInput(1)
count = Count(join)
number_range = NumberRange(number, count, number, lacing=Longest)
code_block_2 = CodeBlock(lst=number_range) { {"cat","dog","foo","bar"}; {lst,lst,lst,lst}; }
byPointsAndResults = Analysis.DataTypes.PointAnalysisData.ByPointsAndResults(join, code_block_2.out0, code_block_2.out1)
string = StringInput("\"Test Point Analysis Display\"")
string_2 = StringInput("\"A test set of values.\"")
unit_types = UnitTypes("Insolation")
byViewAndPointAnalysisData = Revit.AnalysisDisplay.PointAnalysisDisplay.ByViewAndPointAnalysisData(views, byPointsAndResults, string, string_2, unit_types)
