# Dynamo custom node CheckIfStartsWithM.dyf (Dynamo 0.7.1.29946)
# category: Marker

list = Input()
code_block = CodeBlock { 0; }
getItemAtIndex = List.GetItemAtIndex(list, code_block)
character = Input()
startsWith = String.StartsWith(getItemAtIndex, character)
bool = Output(startsWith)
