# Dynamo graph MAGN_102_projectPointsToFace_selfContained.dyn

number = DoubleInput(0..10)
XYZ = Xyz(number, lacing=Longest)
number_2 = DoubleInput(0..100..#3)
number_3 = DoubleInput(-100.000..100..#2)
number_4 = DoubleInput(50)
XYZ_2 = Xyz(number_2, number_3, number_4, lacing=Longest)
best_fit_plane = BestFitPlane(XYZ_2, lacing=Longest)
project_point_on_face_plane = ProjectPointOnFace(XYZ, best_fit_plane, lacing=Longest)
watch = Watch(project_point_on_face_plane.out0)
watch_2 = Watch(project_point_on_face_plane.out2)
watch_3d = Watch3D(XYZ_2)
watch_3 = Watch(project_point_on_face_plane.out1)
