# Dynamo graph MAGN_122_wallsAndFloorsAndLevels.dyn (Dynamo 0.6.3.7993)

number = DoubleInput(0..54..10)
formula = Formula("x+3", x=number, lacing=Longest)
XYZ = Xyz(arg2=formula)
translate_transform = TransformTranslation(XYZ, lacing=Longest)
number_2 = DoubleInput(20)
rectangle = Rectangle(translate_transform, number_2, number_2, lacing=Longest)
curve_loop_list = ListCurveLoop(rectangle, lacing=Longest)
select_floor_type = SelectFloorType(index=2)
string = StringInput("a")
concat_strings = ConcatStrings(arg1=string)
number_to_string = Num2String(number, lacing=Longest)
rest_of_list = Rest(number_to_string)
map = Map(concat_strings, rest_of_list)
level = Level(number, map, lacing=Longest)
floor_by_outline = FloorByOutlineLevelAndOffset(curve_loop_list, select_floor_type, level, lacing=Longest)
select_wall_type = SelectWallType(index=10)
number_3 = DoubleInput(10)
wall_by_curve = WallByCurve(curve_loop_list, level, select_wall_type, number_3, lacing=Longest)
