# Dynamo graph MAGN_2589.dyn (Dynamo 0.7.2.26219)

select_model_element = DSModelElementSelection()  # 1 picked in the model
curve = CurveElement.Curve(select_model_element)
resolution = DoubleSlider(20.948, range=10..50)
code_block = CodeBlock(res=resolution) { 0..1..#res; }
coordinateSystemAtParameter = Curve.CoordinateSystemAtParameter(curve, code_block)
code_block_2 = CodeBlock { 0; }
byCartesianCoordinates = Point.ByCartesianCoordinates(coordinateSystemAtParameter, code_block_2, code_block_2, code_block_2)
frequency = DoubleSlider(1236.998, range=180..2880)
decay_rate = DoubleSlider(5.354, range=1..10)
code_block_3 = CodeBlock(Freq=frequency, res=resolution, rate=decay_rate) { x= 0..Freq..#res; y= 0..40..#res; decay= rate*(Math.Sin(0..180..#res)); Wave= decay*(Math.Sin(x)); ((decay+Wave)*-1)-1; }
code_block_4 = CodeBlock { 0; -15; }
midLevel = DoubleSlider(-10.214, range=-30..-4)
byCartesianCoordinates_2 = Point.ByCartesianCoordinates(coordinateSystemAtParameter, code_block_3.out4, code_block_4.out0, midLevel)
byCartesianCoordinates_3 = Point.ByCartesianCoordinates(coordinateSystemAtParameter, code_block_4.out0, code_block_4.out0, code_block_4.out1)
byThreePoints = Arc.ByThreePoints(byCartesianCoordinates, byCartesianCoordinates_2, byCartesianCoordinates_3)
create_list = List.Create(byCartesianCoordinates, byCartesianCoordinates_2, byCartesianCoordinates_3)
transpose = Transpose(create_list)
byPoints = NurbsCurve.ByPoints(create_list)
byLoft = Surface.ByLoft(byPoints)
byGeometries = ImportInstance.ByGeometries(byLoft)
