# Dynamo graph MAGN_3408.dyn (Dynamo 0.7.2.2921)

number = DoubleInput(-150)
number_2 = DoubleInput(1)
number_3 = DoubleInput(1)
byCoordinates = Point.ByCoordinates(number_2, arg2=number_3, lacing=Longest)
number_4 = DoubleInput(-2)
formula = Formula("-x", x=number_4)
byCoordinates_2 = Vector.ByCoordinates(formula, number_4)
number_5 = DoubleInput(6)
current = Document.Current()
activeView = Document.ActiveView(current, lacing=Longest)
byOriginDirection = Revit.References.RayBounce.ByOriginDirection(byCoordinates, byCoordinates_2, number_5, activeView, lacing=Longest)
watch = Watch(byOriginDirection.out1)
number_6 = DoubleInput(1..5)
firstItem = List.FirstItem(byOriginDirection.out0)
