# Dynamo graph MAGN_4566.dyn (Dynamo 0.7.2.2921)

boolean = BoolSelector(true)
code_block = CodeBlock { 10..50..#5; }
byCoordinates = Point.ByCoordinates(code_block)
empty = List.Empty()
if_ = If(boolean, byCoordinates, empty)
family_types = FamilyTypes("Level Head - Target:1/4\"")
byPoints = AdaptiveComponent.ByPoints(if_, family_types)
watch = Watch(byPoints)
code_block_2 = CodeBlock { {1..3}; {}; }
byCoordinates_2 = Point.ByCoordinates(code_block_2.out0, code_block_2.out1)
