# Dynamo graph MAGN_4737_ReferencePlaneInWatchNode.dyn (Dynamo 0.7.2.2921)

code_block = CodeBlock { Line.ByStartPointEndPoint(Point.ByCoordinates(10,10,10), Point.ByCoordinates(10,0,10)); }
byLine = ReferencePlane.ByLine(code_block)
plane = ReferencePlane.Plane(byLine)
watch = Watch(plane)
