# Dynamo graph MAGN_66.dyn

number = DoubleInput(0.1)
select_curve = CurvesBySelection()  # 1 picked in the model
evaluate_curve_or_edge = XyzOnCurveOrEdge(number, select_curve, lacing=Longest)
reference_point = ReferencePointByXyz(evaluate_curve_or_edge, lacing=Longest)
watch = Watch(reference_point)
number_2 = DoubleInput(0.9)
evaluate_curve_or_edge_2 = XyzOnCurveOrEdge(number_2, select_curve, lacing=Longest)
z_axis = XyzBasisZ(lacing=Longest)
add_xyz = XyzAdd(evaluate_curve_or_edge_2, z_axis, lacing=Longest)
add_xyz_2 = XyzAdd(evaluate_curve_or_edge, z_axis, lacing=Longest)
line = LineBound(add_xyz, add_xyz_2, lacing=Longest)
reference_curve = ReferenceCurve(line, lacing=Longest)
watch_2 = Watch(reference_curve)
