# Dynamo graph Revitnodes_ThroughCBN_2451.dyn (Dynamo 0.7.4.3192)

code_block = CodeBlock { 1; }
byCoordinates = Point.ByCoordinates(code_block, code_block)
code_block_2 = CodeBlock(a=byCoordinates) { ReferencePoint.ByPoint(a); }
