# Dynamo graph SurfaceNew.dyn (Dynamo 0.7.2.2921)

select_model_element = DSModelElementSelection()  # 1 picked in the model
curve = CurveElement.Curve(select_model_element)
select_model_element_2 = DSModelElementSelection()  # 1 picked in the model
curve_2 = CurveElement.Curve(select_model_element_2)
create_list = List.Create(curve, curve_2)
select_model_element_3 = DSModelElementSelection()  # 1 picked in the model
curve_3 = CurveElement.Curve(select_model_element_3)
select_model_element_4 = DSModelElementSelection()  # 1 picked in the model
curve_4 = CurveElement.Curve(select_model_element_4)
create_list_2 = List.Create(curve_3, curve_4)
byLoft = Surface.ByLoft(create_list, create_list_2)
code_block = CodeBlock { 0..1..#20; }
pointAtParameter = Surface.PointAtParameter(byLoft, code_block, code_block, lacing=CrossProduct)
byPoints = NurbsCurve.ByPoints(pointAtParameter)
startPoint = Curve.StartPoint(byPoints)
code_block_2 = CodeBlock { 0.05; }
code_block_3 = CodeBlock { 0; }
tangentAtParameter = Curve.TangentAtParameter(byPoints, code_block_3)
byCenterPointRadiusNormal = Circle.ByCenterPointRadiusNormal(startPoint, code_block_2, tangentAtParameter)
bySweep = Surface.BySweep(byCenterPointRadiusNormal, byPoints)
transpose = List.Transpose(pointAtParameter)
byPoints_2 = NurbsCurve.ByPoints(transpose)
startPoint_2 = Curve.StartPoint(byPoints_2)
code_block_4 = CodeBlock { 0.05; }
code_block_5 = CodeBlock { 0; }
tangentAtParameter_2 = Curve.TangentAtParameter(byPoints_2, code_block_5)
byCenterPointRadiusNormal_2 = Circle.ByCenterPointRadiusNormal(startPoint_2, code_block_4, tangentAtParameter_2)
bySweep_2 = Solid.BySweep(byCenterPointRadiusNormal_2, byPoints_2)
