# Dynamo custom node getCoordinates.dyf (Dynamo 0.7.1.29946)
# category: Marker

list = Input()
character = Input()
checkIfStartsWithM = Custom[CheckIfStartsWithM](character=character)
filter = List.Filter(list, checkIfStartsWithM)
transpose = List.Transpose(filter)
code_block = CodeBlock(vals=transpose) { vals[1]; vals[2]; }
toNumber = String.ToNumber(code_block.out1)
Y = Output(toNumber)
toNumber_2 = String.ToNumber(code_block.out0)
X = Output(toNumber_2)
