# Dynamo graph mobius2.dyn (Dynamo 0.7.2.9691)

code_block = CodeBlock { 1; }
code_block_2 = CodeBlock { -1..1..#100; }
code_block_3 = CodeBlock { 0..360..#100; }
code_block_4 = CodeBlock(v=code_block_2, u=code_block_3) { (1+v/2*Math.Cos(u/2))*Math.Cos(u); }
code_block_5 = CodeBlock(v=code_block_2, u=code_block_3) { (1+v/2*Math.Cos(u/2))*Math.Sin(u); }
code_block_6 = CodeBlock(v=code_block_2, u=code_block_3) { v/2*Math.Sin(1/2*u); }
byCoordinates = Point.ByCoordinates(code_block_4, code_block_5, code_block_6, lacing=Longest)
