# Dynamo graph ClosedCurve.dyn (Dynamo 0.6.2.16485)

XYZ = Xyz(lacing=Longest)
number = DoubleInput(20)
circle = Circle(XYZ, number, lacing=Longest)
number_2 = DoubleInput(0)
evaluate_curve_or_edge = XyzOnCurveOrEdge(number_2, circle, lacing=Longest)
pi = Pi()
evaluate_curve_or_edge_2 = XyzOnCurveOrEdge(pi, circle, lacing=Longest)
bound_curve = BoundCurve(circle, evaluate_curve_or_edge, evaluate_curve_or_edge_2, lacing=Longest)
bound_curve_2 = BoundCurve(circle, evaluate_curve_or_edge_2, evaluate_curve_or_edge, lacing=Longest)
list = NewList(index0=bound_curve, index1=bound_curve_2)
curve_loop = CurveLoop(list, lacing=Longest)
list_2 = NewList(index0=curve_loop)
evaluate_tangent_transform_of = TangentTransformOnCurveOrEdge(number_2, circle, lacing=Longest)  # "Evaluate tangent transform of curve or edge"
number_3 = DoubleInput(1)
XYZ_2 = Xyz(number_2, number_2, number_3, lacing=Longest)
transform_point = TransformPoint(evaluate_tangent_transform_of, XYZ_2, lacing=Longest)
create_extrusion_geometry = CreateExtrusionGeometry(list_2, transform_point, pi, lacing=Longest)
watch = Watch(create_extrusion_geometry)
