# Dynamo graph CurveByPoints.dyn (Dynamo 0.7.2.23643)

select_model_element = DSModelElementSelection()  # 1 picked in the model
select_model_element_2 = DSModelElementSelection()  # 1 picked in the model
select_model_element_3 = DSModelElementSelection()  # 1 picked in the model
select_model_element_4 = DSModelElementSelection()  # 1 picked in the model
create_list = List.Create(select_model_element, select_model_element_2, select_model_element_3, select_model_element_4)
flatten = Flatten(create_list)
boolean = BoolSelector(true)
byReferencePoints = CurveByPoints.ByReferencePoints(flatten, boolean)
