# Dynamo graph CurveByPointsByLine.dyn (Dynamo 0.6.2.16485)

XYZ = Xyz(lacing=Longest)
number = DoubleInput(2)
number_slider = DoubleSliderInput(8.764, range=0..10)
XYZ_2 = Xyz(number, number_slider, number, lacing=Longest)
line = LineBound(XYZ, XYZ_2, lacing=Longest)
curve_by_points_by_line = CurveByPointsByLine(line, lacing=Longest)
