# Dynamo graph CurveLoop.dyn

number = DoubleInput(-1)
number_2 = DoubleInput(1)
number_3 = DoubleInput(0)
XYZ = XYZ(number, number_2, number_3)
XYZ_2 = XYZ(number_2, number_2, number_3)
line = LineBound(XYZ, XYZ_2)
XYZ_3 = XYZ(number_2, number, number_3)
line_2 = LineBound(XYZ_2, XYZ_3)
XYZ_4 = XYZ(number, number, number_3)
line_3 = LineBound(XYZ_3, XYZ_4)
line_4 = LineBound(XYZ_4, XYZ)
list = NewList(index0=line, index1=line_2, index2=line_3, index3=line_4)
curve_loop = CurveLoop(list)
watch_3d = Watch3D(curve_loop)
number_4 = DoubleInput(0.1)
z_axis = XYZBasisZ()
thicken_curve = ThickenCurveLoop(list, number_4, z_axis, lacing=Longest)
