# Dynamo graph CurvebyPointsArc.dyn

number = DoubleInput(20)
number_2 = DoubleInput(0)
XYZ = XYZ(number, number_2, number_2, lacing=Longest)
XYZ_2 = XYZ(number_2, number, number_2, lacing=Longest)
number_3 = DoubleInput(-20)
XYZ_3 = XYZ(number_3, number_2, number_2, lacing=Longest)
arc_by_start_mid_end = ArcStartMiddleEnd(XYZ, XYZ_2, XYZ_3, lacing=Longest)
curve_by_points_by_line = CurveByPointsByLine(arc_by_start_mid_end, lacing=Longest)
