# Dynamo graph CreateWallInDynamo.dyn (Dynamo 0.7.1.27923)

code_block = CodeBlock { Point.ByCoordinates(0,0,0); Point.ByCoordinates(30,0,0); 10; 0; }
byStartPointEndPoint = Line.ByStartPointEndPoint(code_block.out0, code_block.out1)
byElevation = Level.ByElevation(code_block.out3)
wall_types = WallTypes(index=10)
byCurveAndHeight = Wall.ByCurveAndHeight(byStartPointEndPoint, code_block.out2, byElevation, wall_types)
