# Dynamo graph GetSurfaceDomain.dyn

select_face = FormElementBySelection()  # 1 picked in the model
get_surface_domain = SurfaceDomain(select_face)
number = DoubleInput(2)
uv_grid = UVGrid(get_surface_domain, number, number)
watch = Watch(uv_grid)
