# Dynamo graph AC_placementPoints.dyn (Dynamo 0.6.2.26891)

select_family_instance = FamilyInstanceCreatorSelection()  # 1 picked in the model
get_family_instance_location = GetFamilyInstanceLocation(select_family_instance, lacing=Longest)
flatten_completely = FlattenList(get_family_instance_location)
reference_point = ReferencePointByXyz(flatten_completely, lacing=Longest)
reference_point_2 = ReferencePointByXyz(lacing=Longest)
select_divided_surface_families = DividedSurfaceBySelection()  # 1 picked in the model
flatten_completely_2 = FlattenList(select_divided_surface_families)
get_family_instance_location_2 = GetFamilyInstanceLocation(flatten_completely_2, lacing=Longest)
flatten_completely_3 = FlattenList(get_family_instance_location_2)
reference_point_3 = ReferencePointByXyz(flatten_completely_3, lacing=Longest)
