# Dynamo graph GetFamilyInstancesByType.dyn (Dynamo 0.7.1.28556)

family_types = FamilyTypes(index=1)
all_elements_of_family_type = ElementsOfFamilyType(family_types)
count = List.Count(all_elements_of_family_type)
