# Dynamo graph ImportInstance.dyn (Dynamo 0.7.4.3132)

code_block = CodeBlock { Cuboid.ByLengths(5,5,5); }
byGeometries = ImportInstance.ByGeometries(code_block)
code_block_2 = CodeBlock { Sphere.ByCenterPointRadius(Point.ByCoordinates(0,0,0), 5); }
