# Dynamo graph DSReferencePoint.dyn (Dynamo 0.6.2.17657)

number = DoubleInput(5)
number_2 = DoubleInput(6)
number_3 = DoubleInput(7)
byCoordinates = DSFunction(number, number_2, number_3)  # "DSReferencePoint.ByCoordinates"
