# Dynamo graph Arc and Line.dyn (Dynamo 0.6.2.28307)

point_by_selection = PointBySelection()  # 1 picked in the model
xyz_from_ref_point = XyzFromReferencePoint(point_by_selection, lacing=Longest)
point_by_selection_2 = PointBySelection()  # 1 picked in the model
xyz_from_ref_point_2 = XyzFromReferencePoint(point_by_selection_2, lacing=Longest)
point_by_selection_3 = PointBySelection()  # 1 picked in the model
xyz_from_ref_point_3 = XyzFromReferencePoint(point_by_selection_3, lacing=Longest)
arc_by_center_point = ArcStartMiddleEnd(xyz_from_ref_point, xyz_from_ref_point_2, xyz_from_ref_point_3, lacing=Longest)
model_curve = ModelCurve(arc_by_center_point, lacing=Longest)
xyz_basisz = XyzBasisZ(lacing=Longest)
xyz_zero = XyzZero(lacing=Longest)
plane = Plane(xyz_basisz, xyz_zero, lacing=Longest)
sketch_plane = SketchPlane(plane, lacing=Longest)
line = LineBound(xyz_from_ref_point, xyz_from_ref_point_3, lacing=Longest)
list = NewList(index0=arc_by_center_point, index1=line)
watch_3d = Watch3D(list)
boolean = BoolSelector(true)
model_curve_2 = ModelCurve(line, lacing=Longest)
