# Dynamo graph Arc from Ref Points.dyn (Dynamo 0.6.2.28307)

xyz_basisz = XyzBasisZ(lacing=Longest)
xyz_zero = XyzZero(lacing=Longest)
plane = Plane(xyz_basisz, xyz_zero, lacing=Longest)
sketch_plane = SketchPlane(plane, lacing=Longest)
point_by_selection = PointBySelection()  # 1 picked in the model
point_by_selection_2 = PointBySelection()  # 1 picked in the model
point_by_selection_3 = PointBySelection()  # 1 picked in the model
arc_by_center_point = ArcStartMiddleEnd(point_by_selection, point_by_selection_2, point_by_selection_3, lacing=Longest)
model_curve = ModelCurve(arc_by_center_point, lacing=Longest)
watch = Watch(model_curve)
list = NewList(index0=arc_by_center_point)
watch_3d = Watch3D(list)
xyz_from_ref_point = XyzFromReferencePoint(lacing=Longest)
