# Dynamo graph AttractorLogic_Start.dyn (Dynamo 0.6.0.15504)

number = DoubleInput(15)
number_2 = DoubleInput(1)
number_3 = DoubleInput(0)
number_4 = DoubleInput(2)
# note: XYZ Point Grid
xyz_grid = ReferencePtGrid(number, number, number_2, number_3, number_3, number_3, number_4, number_4, number_4, lacing=Longest)
number_slider = DoubleSliderInput(0.939, range=0.1..2)
# note: Circle with variable radii
circle = Circle(xyz_grid, number_slider, lacing=Longest)
watch_3d = Watch3D(circle)
# note: Create a distance-based
# relationship with a single point.
xyz_distance = XyzDistance(lacing=Longest)
number_5 = DoubleInput(30)
divide = Division(arg1=number_5, lacing=Longest)
number_slider_2 = DoubleSliderInput(25.97, range=0..30)
number_slider_3 = DoubleSliderInput(19.925, range=0..30)
number_6 = DoubleInput(0)
# note: 'Attractor' Point
XYZ = Xyz(number_slider_2, number_slider_3, number_6, lacing=Longest)
watch = Watch(XYZ)
# note: Make Revit Stuff
reference_curve = ReferenceCurve(lacing=Longest)
