# Dynamo graph createpoint-end.dyn (Dynamo 0.6.3.7993)

number = DoubleInput(0)
number_2 = DoubleInput(0)
number_slider = DoubleSliderInput(63.275, range=0..100)
XYZ = Xyz(number, number_2, number_slider, lacing=Longest)
reference_point = ReferencePointByXyz(XYZ, lacing=Longest)
number_3 = DoubleInput(0)
