# Dynamo graph divideselectedcurve.dyn (Dynamo 0.6.3.7993)

number = DoubleInput(21)
select_curve = CurvesBySelection()  # 1 picked in the model
number_slider = DoubleSliderInput(33.333, range=0..100)
xyz_array_on_curve = XyzArrayAlongCurve(select_curve, number_slider)
ref_point = ReferencePointByXyz(xyz_array_on_curve, lacing=Longest)
