# Dynamo graph ellipse.dyn (Dynamo 0.6.2.28307)

number_slider = DoubleSliderInput(0, range=0..100)
number = DoubleInput(0)
XYZ = Xyz(number_slider, number, number, lacing=Longest)
number_slider_2 = DoubleSliderInput(30.909, range=0..200)
number_slider_3 = DoubleSliderInput(200, range=0..200)
ellipse = Ellipse(XYZ, number_slider_2, number_slider_3, lacing=Longest)
model_curve = ModelCurve(ellipse, lacing=Longest)
z_axis = XyzBasisZ(lacing=Longest)
plane = Plane(z_axis, XYZ, lacing=Longest)
sketch_plane = SketchPlane(plane, lacing=Longest)
select_curve = CurvesBySelection()  # 1 picked in the model
curve_from_curve_element = CurveFromModelCurve(select_curve, lacing=Longest)
list = NewList(index0=ellipse, index1=curve_from_curve_element)
watch_3d = Watch3D(list)
