# Dynamo graph instparam.dyn (Dynamo 0.7.2.35891)

select_model_element = DSModelElementSelection()  # 1 picked in the model
code_block = CodeBlock { "hostPoint"; }
getParameterValueByName = Element.GetParameterValueByName(select_model_element, code_block, lacing=Longest)
watch = Watch(getParameterValueByName)
