# Dynamo graph instparam2masses.dyn (Dynamo 0.7.2.35891)

select_model_element = DSModelElementSelection()  # 1 picked in the model
code_block = CodeBlock { "H"; }
double_slider = DoubleSlider(40, range=0..100)
setParameterByName = Element.SetParameterByName(select_model_element, code_block, double_slider, lacing=Longest)
select_model_element_2 = DSModelElementSelection()  # 1 picked in the model
setParameterByName_2 = Element.SetParameterByName(select_model_element_2, code_block, double_slider, lacing=Longest)
getParameterValueByName = Element.GetParameterValueByName(setParameterByName_2, code_block, lacing=Longest)
watch = Watch(getParameterValueByName)
