# Dynamo graph scalablegraphfunction.dyn (Dynamo 0.6.2.14024)

number = DoubleInput(-1)
pi = Pi()
multiply = Multiplication(number, pi, lacing=Longest)
number_2 = DoubleInput(32)
number_3 = DoubleInput(start..end..#amount, multiply, pi, number_2, lacing=Longest)
formula = Formula("sin(x)", x=number_3, lacing=Longest)
XYZ = Xyz(number_3, formula, lacing=Longest)
number_slider = DoubleSliderInput(1, range=0.1..10)
scale_xyz = XyzScale(XYZ, number_slider, lacing=Longest)
reference_point = ReferencePointByXyz(scale_xyz, lacing=Longest)
lines_through_points = CurvesThroughPoints(scale_xyz, lacing=Longest)
model_curve = ModelCurve(lines_through_points, lacing=Longest)
