# Dynamo graph SelectAndMultiSelect.dyn (Dynamo 0.7.2.15416)

select_model_element = DSModelElementSelection()  # 1 picked in the model
watch = Watch(select_model_element)
select_model_elements = DSModelElementsSelection()  # 2 picked in the model
watch_2 = Watch(select_model_elements)
