# Dynamo graph SelectEdge.dyn (Dynamo 0.7.2.42284)

select_edge = DSEdgeSelection()  # 1 picked in the model
watch = Watch(select_edge)
code_block = CodeBlock { 0..1..#5; }
pointAtParameter = Curve.PointAtParameter(select_edge, code_block, lacing=Longest)
