# Dynamo graph Selection.dyn (Dynamo 0.6.2.19212)

select_elements = MultipleCurvesBySelection()  # 23 picked in the model
watch = Watch(select_elements)
select_curve = CurvesBySelection()  # 1 picked in the model
watch_2 = Watch(select_curve)
select_face = FormElementBySelection()  # 1 picked in the model
watch_3 = Watch(select_face)
select_family_instance = FamilyInstanceCreatorSelection()  # 1 picked in the model
watch_4 = Watch(select_family_instance)
select_edge = EdgeOnElementBySelection()
watch_5 = Watch(select_edge)
select_level = LevelBySelection()  # 1 picked in the model
watch_6 = Watch(select_level)
select_reference_point = PointBySelection()  # 1 picked in the model
watch_7 = Watch(select_reference_point)
select_model_element = ModelElementSelection()  # 1 picked in the model
watch_8 = Watch(select_model_element)
select_xyz_on_element = XyzBySelection(refXYZparam0=0.6890692918, refXYZparam1=0.8374016436)
watch_9 = Watch(select_xyz_on_element)
