# Dynamo graph SelectionSyncElements.dyn (Dynamo 0.7.2.25771)

select_model_elements = DSModelElementsSelection()  # 5 picked in the model
watch = Watch(select_model_elements)
select_faces = SelectFaces()  # 5 picked in the model
watch_2 = Watch(select_faces)
