# Dynamo graph BlendSolid.dyn

number = DoubleInput(0)
XYZ = XYZ(number, number, number, lacing=Longest)
number_2 = DoubleInput(102)
XYZ_2 = XYZ(number_2, number, number, lacing=Longest)
line = LineBound(XYZ, XYZ_2, lacing=Longest)
number_3 = DoubleInput(150)
XYZ_3 = XYZ(number_2, number_3, number, lacing=Longest)
line_2 = LineBound(XYZ_2, XYZ_3, lacing=Longest)
XYZ_4 = XYZ(number, number_3, number, lacing=Longest)
line_3 = LineBound(XYZ_3, XYZ_4, lacing=Longest)
line_4 = LineBound(XYZ_4, XYZ, lacing=Longest)
list = NewList(index0=line, index1=line_2, index2=line_3, index3=line_4)
curve_loop = CurveLoop(list, lacing=Longest)
number_4 = DoubleInput(200)
XYZ_5 = XYZ(number, number, number_4, lacing=Longest)
XYZ_6 = XYZ(number_3, number, number_4, lacing=Longest)
line_5 = LineBound(XYZ_5, XYZ_6, lacing=Longest)
XYZ_7 = XYZ(number_3, number_3, number_4, lacing=Longest)
line_6 = LineBound(XYZ_6, XYZ_7, lacing=Longest)
XYZ_8 = XYZ(number, number_3, number_4, lacing=Longest)
line_7 = LineBound(XYZ_7, XYZ_8, lacing=Longest)
line_8 = LineBound(XYZ_8, XYZ_5, lacing=Longest)
list_2 = NewList(index0=line_5, index1=line_6, index2=line_7, index3=line_8)
curve_loop_2 = CurveLoop(list_2, lacing=Longest)
create_blend_geometry = CreateBlendGeometry(curve_loop, curve_loop_2, lacing=Longest)
