# Dynamo graph ExtrudeMultiple.dyn (Dynamo 0.7.0.29239)

identity_transform = TransformIdentity(lacing=Longest)
number = DoubleInput(5)
rectangle = Rectangle(identity_transform, number, number, lacing=Longest)
number_2 = DoubleInput(30)
XYZ = Xyz(number_2, lacing=Longest)
translate_transform = TransformTranslation(XYZ, lacing=Longest)
number_3 = DoubleInput(2)
rectangle_2 = Rectangle(translate_transform, number_3, number_3, lacing=Longest)
list = NewList(index0=rectangle, index1=rectangle_2)
z_axis = XyzBasisZ(lacing=Longest)
number_4 = DoubleInput(5)
create_extrusion_geometry = CreateExtrusionGeometry(list, z_axis, number_4, lacing=Longest)
watch_3d = Watch3D(create_extrusion_geometry)
