# Dynamo graph Extrusion.dyn (Dynamo 0.7.0.29239)

identity_transform = TransformIdentity(lacing=Longest)
number = DoubleInput(5)
rectangle = Rectangle(identity_transform, number, number, lacing=Longest)
list = NewList(index0=rectangle)
list_2 = NewList(index0=list)
z_axis = XyzBasisZ(lacing=Longest)
number_2 = DoubleInput(5)
create_extrusion_geometry = CreateExtrusionGeometry(list_2, z_axis, number_2, lacing=Longest)
watch_3d = Watch3D(create_extrusion_geometry)
