# Dynamo graph TopographyFromPoints.dyn (Dynamo 0.6.3.12337)

number = DoubleInput(0..100..3)
XYZ = Xyz(number, number, lacing=CrossProduct)
flatten_completely = FlattenList(XYZ)
xyz_x = XyzGetX(flatten_completely, lacing=Longest)
xyz_y = XyzGetY(flatten_completely, lacing=Longest)
n2d_noise_field = Simplex2D()  # "2D Noise Field"
combine = Combine(n2d_noise_field, xyz_x, xyz_y)
formula = Formula("noise*4", noise=combine, lacing=Longest)
XYZ_2 = Xyz(xyz_x, xyz_y, formula, lacing=Longest)
topography_from_points = TopographyFromPoints(XYZ_2, lacing=Longest)
