# Dynamo graph XYZByPolar.dyn (Dynamo 0.6.2.17383)

number = DoubleInput(2)
n2_pi = PiTimes2()  # "2*Pi"
number_2 = DoubleInput(0..PI..0.1, n2_pi, lacing=Longest)
number_3 = DoubleInput(10)
xyz_by_polar = XyzFromPolar(number, number_2, number_3, lacing=Longest)
