# Dynamo graph XYZBySphericalCoordinates.dyn (Dynamo 0.6.2.17383)

number = DoubleInput(2)
n2_pi = PiTimes2()  # "2*Pi"
number_slider = DoubleSliderInput(0.2258992806, range=0..6.28)
number_2 = DoubleInput(0..PI..x, n2_pi, number_slider, lacing=Longest)
pi = Pi()
number_3 = DoubleInput(0..PI..0.1, pi, lacing=Longest)
xyz_by_spherical = XyzFromSpherical(number, number_2, number_3, lacing=CrossProduct)
watch_3d = Watch3D(xyz_by_spherical)
