# Dynamo graph MAGN-3203.dyn (Dynamo 0.7.0.37647)

# note: Select curve from Revit
select_model_element = DSModelElementSelection()  # 1 picked in the model
# note: Run this graph by opening "Adaptive Component Placement.rfa" from Samples folder.
curve = CurveElement.Curve(select_model_element)
select_model_element_2 = DSModelElementSelection()  # 1 picked in the model
curve_2 = CurveElement.Curve(select_model_element_2)
select_model_element_3 = DSModelElementSelection()  # 1 picked in the model
curve_3 = CurveElement.Curve(select_model_element_3)
select_model_element_4 = DSModelElementSelection()  # 1 picked in the model
curve_4 = CurveElement.Curve(select_model_element_4)
