# Dynamo graph AdaptiveComponent.dyn (Dynamo 0.7.2.36569)

select_model_element = DSModelElementSelection()  # 1 picked in the model
curve = CurveElement.Curve(select_model_element)
double_slider = DoubleSlider(5, range=0..5)
code_block = CodeBlock(x=double_slider) { 0..1..#x; }
pointAtParameter = Curve.PointAtParameter(curve, code_block, lacing=CrossProduct)
select_model_element_2 = DSModelElementSelection()  # 1 picked in the model
curve_2 = CurveElement.Curve(select_model_element_2)
code_block_2 = CodeBlock(x=double_slider) { 0..1..#x; }
pointAtParameter_2 = Curve.PointAtParameter(curve_2, code_block_2, lacing=CrossProduct)
select_model_element_3 = DSModelElementSelection()  # 1 picked in the model
curve_3 = CurveElement.Curve(select_model_element_3)
code_block_3 = CodeBlock(x=double_slider) { 0..1..#x; }
pointAtParameter_3 = Curve.PointAtParameter(curve_3, code_block_3, lacing=CrossProduct)
code_block_4 = CodeBlock(a=pointAtParameter, b=pointAtParameter_2, c=pointAtParameter_3) { {a<1>,b<2>,c<3>}; }
transpose = List.Transpose(code_block_4)
family_types = FamilyTypes(index=2)
ofRepeatedItem = List.OfRepeatedItem(family_types, double_slider)
byPoints = AdaptiveComponent.ByPoints(transpose, ofRepeatedItem, lacing=Longest)
