# Dynamo graph AdaptiveComponentByCurve.dyn (Dynamo 0.6.3.20519)

number = DoubleInput(0)
number_2 = DoubleInput(30)
number_3 = DoubleInput(2)
number_range = NumberRange(number, number_2, number_3, lacing=Longest)
create_list = List.Create()
list_map = Map(number_range, create_list)
select_model_element = DSModelElementSelection()  # 1 picked in the model
curve = CurveElement.Curve(select_model_element, lacing=Longest)
family_types = FamilyTypes(index=0)
byParametersOnCurveReference = AdaptiveComponent.ByParametersOnCurveReference(list_map, curve, family_types, lacing=Longest)
watch = Watch()
