# Dynamo graph AdaptiveComponentByFace.dyn (Dynamo 0.7.1.25189)

get_surface_domain = CodeBlock { {{0,0},{1,1}}; }
watch = Watch(get_surface_domain)
number = DoubleInput(10)
code_block = CodeBlock(domain=get_surface_domain, ucount=number, vcount=number) { domain[0][0]..domain[1][0]..#ucount+1; domain[0][1]..domain[1][1]..#vcount+1; }
byCoordinates = UV.ByCoordinates(code_block.out0, code_block.out1, lacing=CrossProduct)
flatten = Flatten(byCoordinates)
create_list = List.Create()
map = List.Map(flatten, create_list)
select_face = DSFaceSelection()  # 1 picked in the model
family_types = FamilyTypes(index=0)
byParametersOnFace = AdaptiveComponent.ByParametersOnFace(map, select_face, family_types, lacing=Longest)
