# Dynamo graph AD_Vector.dyn (Dynamo 0.6.2.21812)

integer_slider = IntegerSliderInput(9, range=0..10)
formula = Formula("pow(a,2)", a=integer_slider, lacing=Longest)
number = DoubleInput(0..100..#count, formula, lacing=Longest)
number_2 = DoubleInput(0..1..#count, integer_slider, lacing=Longest)
UV = Uv(number_2, number_2, lacing=CrossProduct)
flatten_completely = FlattenList(UV)
select_face = FormElementBySelection()  # 1 picked in the model
surface_normal = NormalEvaluate(flatten_completely, select_face, lacing=Longest)
evaluate_surface = XyzEvaluate(flatten_completely, select_face, lacing=Longest)
number_3 = DoubleInput(1)
analysis_display_manager = SpatialFieldManager(number_3, lacing=Longest)
display_analysis_vectors = SpatialFieldVectors(surface_normal, evaluate_surface, analysis_display_manager, lacing=Longest)
