# Dynamo graph SurfaceAnalysisDisplay_ByViewAndPointAnalysisData.dyn (Dynamo 0.7.2.17096)

views = Views("{3D}")
# note: Select two surfaces.
select_face = DSFaceSelection()  # 1 picked in the model
code_block = CodeBlock { 0..1..0.05; }
byCoordinates = UV.ByCoordinates(code_block, code_block, lacing=CrossProduct)
number = DoubleInput(1)
count = Count(byCoordinates)
number_range = NumberRange(number, count, number, lacing=Longest)
code_block_2 = CodeBlock(lst=number_range) { {"cat","dog","foo","bar"}; {lst,lst,lst,lst}; }
surfaceAnalysisData = Analysis.DataTypes.SurfaceAnalysisData.SurfaceAnalysisData(select_face, byCoordinates, code_block_2.out0, code_block_2.out1)
select_face_2 = DSFaceSelection()  # 1 picked in the model
surfaceAnalysisData_2 = Analysis.DataTypes.SurfaceAnalysisData.SurfaceAnalysisData(select_face_2, byCoordinates, code_block_2.out0, code_block_2.out1)
join = List.Join(surfaceAnalysisData, surfaceAnalysisData_2)
string = StringInput("\"Test Point Analysis Display\"")
string_2 = StringInput("\"A test set of values.\"")
unit_types = UnitTypes("Insolation")
byViewAndFaceAnalysisData = Revit.AnalysisDisplay.FaceAnalysisDisplay.ByViewAndFaceAnalysisData(views, join, string, string_2, unit_types)
