# Dynamo graph SurfaceAnalysisDisplay_ByViewAndPointsAndValues.dyn (Dynamo 0.7.2.37234)

views = Views("PointAnalysisDisplay")
select_face = DSFaceSelection()  # 1 picked in the model
flatten = Flatten(select_face)
firstItem = List.FirstItem(flatten)
code_block = CodeBlock { 0..1..0.05; }
byCoordinates = UV.ByCoordinates(code_block, code_block, lacing=CrossProduct)
flatten_2 = Flatten(byCoordinates)
number = DoubleInput(1)
count = Count(flatten_2)
number_range = NumberRange(number, count, number)
string = StringInput("\"Test Point Analysis Display\"")
string_2 = StringInput("\"A test set of values.\"")
unit_types = UnitTypes("Insolation")
byViewFacePointsAndValues = Revit.AnalysisDisplay.FaceAnalysisDisplay.ByViewFacePointsAndValues(views, firstItem, flatten_2, number_range, string, string_2, unit_types)
