# Dynamo graph VectorAnalysisDisplay_ByViewPointsAndValues.dyn (Dynamo 0.7.2.27088)

views = Views("PointAnalysisDisplay")
select_face = DSFaceSelection()  # 1 picked in the model
code_block = CodeBlock { 0..1..0.05; }
pointAtParameter = Surface.PointAtParameter(select_face, code_block, code_block, lacing=CrossProduct)
flatten = Flatten(pointAtParameter)
# note: Select two surfaces.
select_face_2 = DSFaceSelection()  # 1 picked in the model
pointAtParameter_2 = Surface.PointAtParameter(select_face_2, code_block, code_block, lacing=CrossProduct)
flatten_2 = Flatten(pointAtParameter_2)
join = List.Join(flatten, flatten_2)
ZAxis = Vector.ZAxis()
count = Count(join)
ofRepeatedItem = List.OfRepeatedItem(ZAxis, count)
vector_scale = DoubleSlider(7.074926686, range=0..100)
count_2 = Count(ofRepeatedItem)
code_block_2 = CodeBlock(max=vector_scale, count=count_2) { 0.1..max..#count; }
scale = Vector.Scale(ofRepeatedItem, code_block_2)
string = StringInput("\"Test Point Analysis Display\"")
string_2 = StringInput("\"A test set of values.\"")
unit_types = UnitTypes("Insolation")
byViewPointsAndVectorValues = Revit.AnalysisDisplay.VectorAnalysisDisplay.ByViewPointsAndVectorValues(views, join, scale, string, string_2, unit_types)
