# Dynamo graph Defect_MAGN_2576.dyn (Dynamo 0.7.0.17754)

number = DoubleInput(0)
byOrigin = CoordinateSystem.ByOrigin(number, number, number)
# note: Wall Distance
double_slider = DoubleSlider(18.833, range=1..20)
byWidthHeight = Rectangle.ByWidthHeight(byOrigin, double_slider, double_slider, lacing=Longest)
curves = PolyCurve.Curves(byWidthHeight)
# note: Wall Fillet Radius
double_slider_2 = DoubleSlider(4, range=1..4)
boolean = BoolSelector(false)
filletPlanarPolyCurve = PolyCurve.FilletPlanarPolyCurve(byWidthHeight, double_slider_2, boolean)
curves_2 = PolyCurve.Curves(filletPlanarPolyCurve)
floor_types = FloorTypes()
levels = Levels(index=0)
byOutlineTypeAndLevel = Floor.ByOutlineTypeAndLevel(curves_2, floor_types, levels)
