# Dynamo graph MAGN_3488.dyn (Dynamo 0.7.5.3271)

select_model_element = DSModelElementSelection()  # 1 picked in the model
get_family_parameter = FamilyInstanceParameters(select_model_element)
select_model_element_2 = DSModelElementSelection()  # 1 picked in the model
getParameterValueByName = Element.GetParameterValueByName(select_model_element_2, get_family_parameter, lacing=Longest)
setParameterByName = Element.SetParameterByName(select_model_element, get_family_parameter, getParameterValueByName, lacing=Longest)
watch = Watch(getParameterValueByName)
value = DynamoUnits.SIUnit.Value(getParameterValueByName)
