# Dynamo graph MAGN_3784.dyn (Dynamo 0.7.0.37449)

integer_slider = IntegerSlider(0, range=0..100)
byCoordinates = ReferencePoint.ByCoordinates(integer_slider)
element_types = ElementTypes(index=223)
all_elements_of_type = ElementsOfType(element_types)
watch = Watch(all_elements_of_type)
