# Dynamo graph MAGN_4511_NullInputToForm.ByLoftCrossSections.dyn (Dynamo 0.7.2.37099)

referenceCurveByCurve = ModelCurve.ReferenceCurveByCurve()
byLoftCrossSections = Form.ByLoftCrossSections(referenceCurveByCurve)
code_block = CodeBlock { true; }
byLoftCrossSections_2 = Form.ByLoftCrossSections(referenceCurveByCurve, code_block)
