# Dynamo graph MAGN_529_GetFamilyInstanceLocation.dyn (Dynamo 0.7.2.2921)

family_types = FamilyTypes("Family5:Family5")
all_elements_of_family_type = ElementsOfFamilyType(family_types)
location = FamilyInstance.Location(all_elements_of_family_type, lacing=Longest)
code_block = CodeBlock { 6; }
chop = List.Chop(location, code_block)
byPoints = NurbsCurve.ByPoints(chop)
byLoft = Surface.ByLoft(byPoints)
