# Dynamo graph MarkerData.dyn (Dynamo 0.7.4.3105)

file_path = Filename("C:\Users\prabhum\Desktop\4797\PlotData.csv")
fromPath = FileObject(file_path)  # "File.FromPath"
readText = File.ReadText(fromPath)
code_block = CodeBlock { "\n"; }
split = String.Split(readText, code_block)
code_block_2 = CodeBlock { ","; }
split_2 = String.Split(split, code_block_2)
code_block_3 = CodeBlock { "S"; }
getCoordinates = Custom[getCoordinates](list=split_2, character=code_block_3)
byCoordinates = Point.ByCoordinates(getCoordinates.X, getCoordinates.Y)
code_block_4 = CodeBlock { "M"; }
getCoordinates_2 = Custom[getCoordinates](list=split_2, character=code_block_4)
byCoordinates_2 = Point.ByCoordinates(getCoordinates_2.X, getCoordinates_2.Y)
code_block_5 = CodeBlock { "V"; }
getCoordinates_3 = Custom[getCoordinates](list=split_2, character=code_block_5)
byCoordinates_3 = Point.ByCoordinates(getCoordinates_3.X, getCoordinates_3.Y)
code_block_6 = CodeBlock { 2; }
chop = List.Chop(byCoordinates_3, code_block_6)
byBestFitThroughPoints = Line.ByBestFitThroughPoints(chop)
code_block_7 = CodeBlock { "P"; }
getCoordinates_4 = Custom[getCoordinates](list=split_2, character=code_block_7)
byCoordinates_4 = Point.ByCoordinates(getCoordinates_4.X, getCoordinates_4.Y)
byPoints = Polygon.ByPoints(byCoordinates_4)
