# Dynamo graph mobius.dyn (Dynamo 0.7.2.9691)

code_block = CodeBlock { 1; }
code_block_2 = CodeBlock { -0.3..0.3..#100; }
code_block_3 = CodeBlock { 0..360..#100; }
code_block_4 = CodeBlock(R=code_block, S=code_block_2, t=code_block_3) { R+S*Math.Cos(1/2*t)*Math.Cos(t); }
code_block_5 = CodeBlock(R=code_block, S=code_block_2, t=code_block_3) { R+S*Math.Cos(1/2*t)*Math.Sin(t); }
code_block_6 = CodeBlock(s=code_block_2, t=code_block_3) { s*Math.Sin(1/2*t); }
byCoordinates = Point.ByCoordinates(code_block_4, code_block_5, code_block_6, lacing=Longest)
byGeometries = ImportInstance.ByGeometries(byCoordinates)
byGeometry = ImportInstance.ByGeometry(byCoordinates)
