# Dynamo graph LacingTest.dyn (Dynamo 0.7.0.36195)

number = DoubleInput(0)
number_2 = DoubleInput(3)
number_3 = DoubleInput(1)
number_range = NumberRange(number, number_2, number_3, lacing=Longest)
number_4 = DoubleInput(4)
number_range_2 = NumberRange(number, number_4, number_3, lacing=Longest)
byCoordinates = Point.ByCoordinates(number, number_range, number_range_2, lacing=Longest)
byPoint = ReferencePoint.ByPoint(byCoordinates, lacing=Longest)
count = List.Count(byPoint, lacing=Longest)
watch = Watch(count)
