# Dynamo graph CurveByPoints.dyn

select_point = PointBySelection()  # 1 picked in the model
select_point_2 = PointBySelection()  # 1 picked in the model
select_point_3 = PointBySelection()  # 1 picked in the model
select_point_4 = PointBySelection()  # 1 picked in the model
list = NewList(item_s=select_point, index1=select_point_2, index2=select_point_3, index3=select_point_4)
boolean = BoolSelector(true)
curve_by_pts = CurveByPoints(list, boolean)
