# Dynamo graph OffsetCurve.dyn (Dynamo 0.6.2.16485)

number = DoubleInput(3)
number_2 = DoubleInput(5)
ellipse = Ellipse(arg1=number, arg2=number_2)
watch_3d = Watch3D()
number_3 = DoubleInput(0)
XYZ = Xyz(number_3, number_3, number_3)
number_4 = DoubleInput(1)
XYZ_2 = Xyz(number_4, number_3, number_4)
number_5 = DoubleInput(2)
XYZ_3 = Xyz(number_5, number_3, number_3)
number_6 = DoubleInput(3)
XYZ_4 = Xyz(number_6, number_3, number_4)
list = NewList(index0=XYZ, index1=XYZ_2, index2=XYZ_3, index3=XYZ_4)
nurbs_spline = GeometryCurveNurbSpline(list)
number_7 = DoubleInput(0.2)
y_axis = XyzBasisY()
offset_curve = OffsetCrv(nurbs_spline, number_7, y_axis)
watch_3d_2 = Watch3D(offset_curve)
pi = Pi()
number_8 = DoubleInput(1.5)
multiply = Multiplication(pi, number_8)
arc_by_ctr_pt = ArcCenter(XYZ, number, number_3, multiply)
z_axis = XyzBasisZ()
offset_curve_2 = OffsetCrv(arc_by_ctr_pt, number_7, z_axis)
watch_3d_3 = Watch3D(offset_curve_2)
hermite_spline = HermiteSpline(list)
offset_curve_3 = OffsetCrv(hermite_spline, number_7, y_axis)
watch_3d_4 = Watch3D(offset_curve_3)
