# Dynamo graph BindingCloseReopen.dyn (Dynamo 0.7.1.27923)

select_model_element = DSModelElementSelection()
boundingBox = Element.BoundingBox(select_model_element)
code_block = CodeBlock { Point.ByCoordinates(0,-1.8,3); }
contains = BoundingBox.Contains(boundingBox, code_block)
watch = Watch(contains)
