# Dynamo graph CreateDifferentNumberOfPoints.dyn (Dynamo 0.7.1.27923)

integer_slider = IntegerSlider(4, range=0..10)
integer_slider_2 = IntegerSlider(2, range=0..10)
code_block = CodeBlock(x_num=integer_slider, y_num=integer_slider_2) { 0..20..#x_num; 0..10..#y_num; 0; }
byCoordinates = ReferencePoint.ByCoordinates(code_block.out0, code_block.out1, code_block.out2, lacing=CrossProduct)
