# Dynamo graph CreateReferencePointInPythonNode.dyn (Dynamo 0.7.2.2921)

double_slider = DoubleSlider(52.518, range=0..100)
python_script = Python(IN[0]=double_slider)
# ---------- python_script.python (14 lines) ----------
import clr
import sys
sys.path.append('.\Revit_2014');
clr.AddReference('ProtoGeometry')
clr.AddReference('RevitNodes')
from Autodesk.DesignScript.Geometry import *
from Revit.Elements import *
#The inputs to this node will be stored as a list in the IN variable.
dataEnteringNode = IN

pnt = ReferencePoint.ByCoordinates(IN[0],0,0)

#Assign your output to the OUT variable
OUT = pnt
# ----------------------------------------
X = ReferencePoint.X(python_script)
