# Dynamo graph ErrorToNormal.dyn (Dynamo 0.7.4.3092)

origin = Point.Origin()
integer_slider = IntegerSlider(2, range=0..10)
byCenterPointRadius = Circle.ByCenterPointRadius(origin, integer_slider)
byCurve = ModelCurve.ByCurve(byCenterPointRadius)
