# Dynamo graph magn-2523.dyn (Dynamo 0.7.2.22072)

number = DoubleInput(0)
byOrigin = CoordinateSystem.ByOrigin(number, number, number)
# note: Wall Distance
double_slider = DoubleSlider(19.89, range=1..20)
byWidthHeight = Rectangle.ByWidthHeight(byOrigin, double_slider, double_slider, lacing=Longest)
curves = PolyCurve.Curves(byWidthHeight)
family_types = FamilyTypes("Sofa-Pensi:65\"")
# note: Wall Fillet Radius
double_slider_2 = DoubleSlider(4, range=1..4)
boolean = BoolSelector(false)
fillet = PolyCurve.Fillet(byWidthHeight, double_slider_2, boolean)
curves_2 = PolyCurve.Curves(fillet)
endPoint = Curve.EndPoint(curves_2)
levels = Levels("Level 1")
byPointAndLevel = FamilyInstance.ByPointAndLevel(family_types, endPoint, levels)
