# Dynamo graph AC_locationInDividedSurface.dyn (Dynamo 0.7.1.28556)

select_divided_surface_families = DSDividedSurfaceFamiliesSelection()  # 25 picked in the model
location = FamilyInstance.Location(select_divided_surface_families, lacing=Longest)
watch = Watch(location)
