# Dynamo graph GetFamilyInstanceLocation.dyn (Dynamo 0.7.1.28556)

family_types = FamilyTypes(index=1)
all_elements_of_family_type = ElementsOfFamilyType(family_types)
watch = Watch(all_elements_of_family_type)
location = FamilyInstance.Location(all_elements_of_family_type, lacing=Longest)
code_block = CodeBlock(pts=location) { Math.Average(pts.X); Math.Average(pts.Y); Math.Average(pts.Z); }
byCoordinates = Point.ByCoordinates(code_block.out0, code_block.out1, code_block.out2)
