# Dynamo graph GeometryCalibration.dyn (Dynamo 0.7.2.2921)

select_model_elements = DSModelElementsSelection()  # 17 picked in the model
# note: Element.Geometry does not return single surfaces defined in masses.
geometry = Element.Geometry(select_model_elements)
# note: Element.Faces throws an ACIS access exception.
faces = Element.Faces(select_model_elements)
# note: Select Faces does not properly transform family instances. Many are placed at the origin.
select_faces = SelectFaces()  # 721 picked in the model
select_face = DSFaceSelection()  # 1 picked in the model
# note: Adaptive Components don't transform correctly.
select_faces_2 = SelectFaces()  # 3 picked in the model
