# Dynamo graph EdgePlaneIntersection.dyn (Dynamo 0.6.3.19259)

select_face = FormElementBySelection()  # 1 picked in the model
explode = GeometryObjectsFromRoot(select_face, lacing=Longest)
watch = Watch(explode)
select_curve = CurvesBySelection()  # 1 picked in the model
geometry_curve_from_model_curve = CurveFromModelCurve(select_curve, lacing=Longest)
number = DoubleInput(0.5)
curve_derivatives = ComputeCurveDerivatives(geometry_curve_from_model_curve, number, lacing=Longest)
transform_basis_x = BasisX(curve_derivatives, lacing=Longest)
z_axis = XyzBasisZ(lacing=Longest)
xyz_cross_product = XyzCrossProduct(transform_basis_x, z_axis, lacing=Longest)
transform_origin = Origin(curve_derivatives, lacing=Longest)
plane_by_normal_origin = Plane(xyz_cross_product, transform_origin, lacing=Longest)
curve_plane_intersection = CurvePlaneIntersection(explode, plane_by_normal_origin, lacing=Longest)
reference_point = ReferencePointByXyz(curve_plane_intersection, lacing=Longest)
