# Dynamo graph FaceFaceIntersection.dyn

select_face = FormElementBySelection()  # 1 picked in the model
select_face_2 = FormElementBySelection()  # 1 picked in the model
face_face_intersection = FaceFaceIntersection(select_face, select_face_2, lacing=Longest)
watch = Watch(face_face_intersection.out0)
watch_2 = Watch(face_face_intersection.out1)
select_face_3 = FormElementBySelection()  # 1 picked in the model
face_face_intersection_2 = FaceFaceIntersection(select_face, select_face_3, lacing=Longest)
watch_3 = Watch(face_face_intersection_2)
select_face_4 = FormElementBySelection()  # 1 picked in the model
face_face_intersection_3 = FaceFaceIntersection(select_face, select_face_4, lacing=Longest)
watch_4 = Watch(face_face_intersection_3)
