# Dynamo graph Length.dyn

n0 = LengthInput(0)  # "0"
watch = Watch(n0)
n1_2 = LengthInput(-0.171875)  # "1' 2""
watch_2 = Watch(n1_2)
n1_2_2 = LengthInput(-0.8333333333)  # "-1' -2""
watch_3 = Watch(n1_2_2)
n8_3_32 = LengthInput(-8.0078125)  # "-8 3/32""
watch_4 = Watch(n8_3_32)
n8_4_0_16 = LengthInput(-8.333333333)  # "-8' 4 0/16""
watch_5 = Watch(n8_4_0_16)
