# Dynamo graph Level.dyn (Dynamo 0.7.0.26273)

number = DoubleInput(0..10..2)
concat_strings = ConcatStrings()
string = StringInput("Level ")
list = NewList(index0=string)
number_to_string = Num2String(number, lacing=Longest)
cartesian_product = CartProd(concat_strings, list, number_to_string)
level = Level(number, cartesian_product, lacing=Longest)
list_length = Length(number)
