# Dynamo graph Levels.dyn (Dynamo 0.7.2.2921)

code_block = CodeBlock { 20; 30; }
code_block_2 = CodeBlock { "02 - Second Level"; }
byElevationAndName = Level.ByElevationAndName(code_block.out1, code_block_2)
levels = Levels("Level 1")
code_block_3 = CodeBlock { 5; 8; }
byLevelAndOffset = Level.ByLevelAndOffset(levels, code_block_3.out0)
code_block_4 = CodeBlock { "00 - Middle Level"; }
byLevelOffsetAndName = Level.ByLevelOffsetAndName(levels, code_block_3.out1, code_block_4)
byElevation = Level.ByElevation(code_block.out0)
