# Dynamo graph GetMaterialByName.dyn

select_family_instance = FamilyInstanceCreatorSelection()  # 1 picked in the model
string = StringInput("material")
string_2 = StringInput("Chipboard")
get_material_by_name = Material(string_2)
set_family_instance_parameter = FamilyInstanceParameterSetter(select_family_instance, string, get_material_by_name, lacing=Longest)
select_family_instance_2 = FamilyInstanceCreatorSelection()  # 1 picked in the model
string_3 = StringInput("Glass")
get_material_by_name_2 = Material(string_3)
set_family_instance_parameter_2 = FamilyInstanceParameterSetter(select_family_instance_2, string, get_material_by_name_2, lacing=Longest)
select_family_instance_3 = FamilyInstanceCreatorSelection()  # 1 picked in the model
string_4 = StringInput("Poche")
get_material_by_name_3 = Material(string_4)
set_family_instance_parameter_3 = FamilyInstanceParameterSetter(select_family_instance_3, string, get_material_by_name_3, lacing=Longest)
