# Dynamo graph Raybounce_Template_cleaned.dyn (Dynamo 0.7.2.2921)

# note: Pick the plane Face you want the rays to intersect (reflect).
select_face = DSFaceSelection()  # 1 picked in the model
code_block = CodeBlock { 0.1..0.9..#5; }
pointAtParameter = Surface.PointAtParameter(select_face, code_block, code_block, lacing=CrossProduct)
flatten = Flatten(pointAtParameter)
# note: Selects the active view Sun Seetings to calculate ray direction.
current = SunSettings()  # "SunSettings.Current"
sunDirection = SunSettings.SunDirection(current)
code_block_2 = CodeBlock { 2; }
scale = Vector.Scale(sunDirection, code_block_2)
add = Point.Add(flatten, scale, lacing=Longest)
reverse = Vector.Reverse(sunDirection)
number = DoubleInput(6)
current_2 = Document.Current()
activeView = Document.ActiveView(current_2, lacing=Longest)
byOriginDirection = Revit.References.RayBounce.ByOriginDirection(add, reverse, number, activeView, lacing=Longest)
watch = Watch(byOriginDirection.out1)
code_block_3 = CodeBlock { false; }
byPoints = PolyCurve.ByPoints(arg1=code_block_3)
map = List.Map(byOriginDirection.out0, byPoints)
watch_2 = Watch(map)
isNull = Object.IsNull(map)
filterByBoolMask = List.FilterByBoolMask(map, isNull)
curves = PolyCurve.Curves(filterByBoolMask.out1)
byCurve = ModelCurve.ByCurve(curves)
flatten_2 = Flatten(byCurve)
