# Dynamo graph ReferenceCurve.dyn

list = NewList()
number = DoubleInput(0)
number_2 = DoubleInput(5)
number_3 = DoubleInput(1)
number_sequence = NumberSeq(number, number_2, number_3, lacing=Longest)
XYZ = XYZ(arg2=number_sequence, lacing=Longest)
number_4 = DoubleInput("2,000")
number_5 = DoubleInput(-5)
XYZ_2 = XYZ(number_4, number_5, number_sequence, lacing=Longest)
number_6 = DoubleInput("10,000")
XYZ_3 = XYZ(arg1=number_6, arg2=number_sequence, lacing=Longest)
XYZ_4 = XYZ(number_6, arg2=number_sequence, lacing=Longest)
combine = Combine(list, XYZ, XYZ_2, XYZ_3, XYZ_4)
hermite_spline = HermiteSpline(combine, lacing=Longest)
reference_curve = ReferenceCurve(hermite_spline, lacing=Longest)
