# Dynamo graph Arc.dyn (Dynamo 0.6.2.28307)

z_axis = XyzBasisZ(lacing=Longest)
xyz_zero = XyzZero(lacing=Longest)
plane = Plane(z_axis, xyz_zero, lacing=Longest)
sketch_plane = SketchPlane(plane, lacing=Longest)
select_point = PointBySelection()  # 1 picked in the model
xyz_from_ref_point = XyzFromReferencePoint(select_point, lacing=Longest)
select_point_2 = PointBySelection()  # 1 picked in the model
xyz_from_ref_point_2 = XyzFromReferencePoint(select_point_2, lacing=Longest)
select_point_3 = PointBySelection()  # 1 picked in the model
xyz_from_ref_point_3 = XyzFromReferencePoint(select_point_3, lacing=Longest)
arc_by_center_point = ArcStartMiddleEnd(xyz_from_ref_point, xyz_from_ref_point_2, xyz_from_ref_point_3, lacing=Longest)
model_curve = ModelCurve(arc_by_center_point, lacing=Longest)
watch = Watch(model_curve)
list = NewList(index0=arc_by_center_point)
watch_3d = Watch3D(list)
