# Dynamo graph CSVtoStuff.dyn (Dynamo 0.7.4.3075)

# note: Browse a CSV file that has numbers
# in x, y, and z coordinate space
file_path = Filename("C:\Autodesk\Dynamo\Core\samples\15 Spreadsheets\helix.csv")
fromPath = FileObject(file_path)  # "File.FromPath"
readText = File.ReadText(fromPath)
# note: Split the String on
# A carriage return <enter>
string = StringInput("\n")
split = String.Split(readText, string)
# note: Custom Node.
# Double click to look inside
parse_list_of_lists = Custom[Parse List of Lists]()
double_slider = DoubleSlider(1.639, range=0..20)
# note: Adjust the overall distribution
# of the coordinate points
scale = Geometry.Scale(parse_list_of_lists, double_slider, lacing=Longest)
# note: Visualize XYZs in the Watch 3d
# before making Revit Elements
watch_3d = Watch3D(scale)
# note: connect Watch 3d to make Revit
# Reference Points
byPoint = ReferencePoint.ByPoint(lacing=Longest)
# note: Pick a loaded family from the
# dropdown to place
family_types = FamilyTypes()
# note: Connect to Watch 3d to place families
byPoint_2 = FamilyInstance.ByPoint(family_types, lacing=Longest)
