# Dynamo graph DaylightingExtractingData.dyn (Dynamo 0.7.2.22882)

# note: Y
# note: Number Of Columns * Row + Column
# note: Use this position to lookup illuminance at a pixel coordinate
# note: use the exact position of an xyz in world coordinates to find an illumiance value by using the index of the XYZ in a list of sampling positons
# note: use that index on the list of illuminance values
# note: again we need to extract the first list of xyz positons because the render returns a list of grids ( if we had supplied multiple render jobs)

string = StringInput("{3D}")
export_cloud_render_data = ExportDocumentRenderData(string)
end = Revit.Transaction.Transaction.End(export_cloud_render_data)
upload_cloud_render_data = UploadRenderData(end)
number = DoubleInput(150)
number_2 = DoubleInput(-100)
number_3 = DoubleInput(-100)
number_4 = DoubleInput(3)
byCoordinates = Point.ByCoordinates(number_2, number_3, number_4, lacing=Longest)
number_5 = DoubleInput(100)
number_6 = DoubleInput(-100)
number_7 = DoubleInput(3)
byCoordinates_2 = Point.ByCoordinates(number_5, number_6, number_7, lacing=Longest)
number_8 = DoubleInput(-100)
number_9 = DoubleInput(100)
number_10 = DoubleInput(3)
# note: X
byCoordinates_3 = Point.ByCoordinates(number_8, number_9, number_10, lacing=Longest)
skyModelType = SkyModelTypeDropDown(index=0)
byTypeConstants = Analyze.Render.SkyModel.ByTypeConstants(skyModelType, lacing=Longest)
number_11 = DoubleInput(40)
number_12 = DoubleInput(-71)
number_13 = DoubleInput(12)
number_14 = DoubleInput(5)
byDateInformation = Analyze.Render.DateTime.ByDateInformation(arg3=number_13, arg6=number_14, lacing=Longest)
bySkyModelLocationDate = Analyze.Render.RenderingEnvironment.BySkyModelLocationDate(byTypeConstants, number_11, number_12, byDateInformation, lacing=Longest)
# note: This lets us index into the list of colors, or illuminance values, and pull out the value at an (x,y) within the grid of values... not positions in space
byViewNameDivisionsGridBoundary = Analyze.Daylighting.CloudDaylightingJob.ByViewNameDivisionsGridBoundary(string, number, number, byCoordinates, byCoordinates_2, byCoordinates_3, bySkyModelLocationDate, lacing=Longest)
boolean = BoolSelector(false)
do_cloud_render = CloudRender(upload_cloud_render_data, byViewNameDivisionsGridBoundary, boolean)
# note: Number Of Columns
parse = Analyze.Daylighting.DaylightingResults.Parse(do_cloud_render, lacing=Longest)
number_15 = DoubleInput(0)
toImage = Analyze.Daylighting.DaylightingResults.ToImage(parse, number_15, lacing=Longest)
firstItem = List.FirstItem(toImage)
watch_image = WatchImageCore(firstItem)
illuminanceValues = Analyze.Daylighting.DaylightingResults.IlluminanceValues(parse, lacing=Longest)
toSRGB = Analyze.Daylighting.Illuminance.ToSRGB(illuminanceValues, lacing=Longest)
firstItem_2 = List.FirstItem(toSRGB)
resolution = Analyze.Daylighting.DaylightingResults.Resolution(parse, lacing=Longest)
firstItem_3 = List.FirstItem(resolution)
# note: when hitting run render will upload and take a few minutes to return - run button will grey out - check the console for progress
number_16 = DoubleInput(1)
getItemAtIndex = List.GetItemAtIndex(firstItem_3, number_16)
number_17 = DoubleInput(75)
mul = getItemAtIndex * number_17  # lacing=Longest
number_18 = DoubleInput(75)
add = mul + number_18  # lacing=Longest
getItemAtIndex_2 = List.GetItemAtIndex(firstItem_2, add)
points = Analyze.Daylighting.DaylightingResults.Points(parse, lacing=Longest)
firstItem_4 = List.FirstItem(points)
number_19 = DoubleInput(-100)
number_20 = DoubleInput(-100)
number_21 = DoubleInput(3)
byCoordinates_4 = Point.ByCoordinates(number_19, number_20, number_21, lacing=Longest)
python_script = Python(IN[0]=firstItem_4, IN[1]=byCoordinates_4)
# ---------- python_script.python (22 lines) ----------
# Default imports
import clr
clr.AddReference('RevitAPI')
clr.AddReference('RevitAPIUI')
from Autodesk.Revit.DB import *
import Autodesk
import sys
import clr
path = r'C:\Autodesk\Dynamo\Core'
exec_path = r'C:\Autodesk\Dynamo\Core\dll'
sys.path.append(path)
sys.path.append(exec_path)
clr.AddReference('LibGNet')
from Autodesk.LibG import *

#The input to this node will be stored in the IN[0]...INX variable(s).
list = IN[0]
value = IN[1]

index, item = next(((i, x) for i, x in enumerate(list) if x.IsAlmostEqualTo(value,.01)), (None,None))

OUT = index
# ----------------------------------------
getItemAtIndex_3 = List.GetItemAtIndex(firstItem_2, python_script)
