# Dynamo graph FormFromCurveSelection.dyn (Dynamo 0.7.1.28080)

boolean = BoolSelector(false)
select_model_element = DSModelElementSelection()  # 1 picked in the model
select_model_element_2 = DSModelElementSelection()  # 1 picked in the model
create_list = List.Create(select_model_element, select_model_element_2)
byLoftCrossSections = Form.ByLoftCrossSections(create_list)
