# Dynamo graph FormulaCurve.dyn (Dynamo 0.7.2.35891)

number = DoubleInput(0)
double_slider = DoubleSlider(6.283, range=0..6.283)
number_2 = DoubleInput(0.2)
number_range = NumberRange(number, double_slider, number_2, lacing=Longest)
formula = Formula("Sin(x)", x=number_range, lacing=Longest)
double_slider_2 = DoubleSlider(0.746, range=0..1)
mul = number_range * double_slider_2  # lacing=Longest
formula_2 = Formula("Cos(x)+ Sin(a)", x=number_range, a=mul, lacing=Longest)
number_3 = DoubleInput(0)
byCoordinates = Point.ByCoordinates(formula, formula_2, number_3, lacing=Longest)
double_slider_3 = DoubleSlider(34.444, range=0..40)
scale = Geometry.Scale(byCoordinates, double_slider_3, lacing=Longest)
byPoints = NurbsCurve.ByPoints(scale, lacing=Longest)
watch_3d = Watch3D(byPoints)
referenceCurveByCurve = ModelCurve.ReferenceCurveByCurve(byPoints, lacing=Longest)
