# Dynamo graph Geometry_Curves.dyn (Dynamo 0.7.1.11027)

byCoordinates = Point.ByCoordinates()
number = DoubleInput(5)
byCoordinates_2 = Point.ByCoordinates(arg1=number)
# note: Multiple creation methods exist for most curves.
byStartPointEndPoint = Line.ByStartPointEndPoint(byCoordinates, byCoordinates_2)
length = Curve.Length(byStartPointEndPoint)
number_2 = DoubleInput(10)
byCoordinates_3 = Point.ByCoordinates(number_2, number_2)
number_3 = DoubleInput(15)
byCoordinates_4 = Point.ByCoordinates(number_3)
create = List.Create(byCoordinates, byCoordinates_2, byCoordinates_3, byCoordinates_4)
boolean = BoolSelector(true)
byControlPoints = NurbsCurve.ByControlPoints(create, arg2=boolean)
byPoints = PolyCurve.ByPoints(create)
code_block = CodeBlock { 0..1..#20; }
# note: Curves, Polycurves (collections of Curves), Nurbs, and Lines all derive from "Curves", and so all Curve "Actions" and "Queries" can be done to all of them
pointAtParameter = Curve.PointAtParameter(byPoints, code_block)
curves = PolyCurve.Curves(byPoints)
byPoints_2 = NurbsCurve.ByPoints(create)
create_2 = List.Create(curves, byPoints_2)
# note: Pass any curve element to Revit Elements that are driven by Lines or other Curves to create them
byCurve = ModelCurve.ByCurve(create_2)
flatten = Flatten(byCurve)
