# Dynamo graph SimpleCloudRender.dyn (Dynamo 0.7.2.22882)

# note: when hitting run render will upload and take a few minutes to return - run button will grey out - check the console for progress

string = StringInput("{3D}")
export_cloud_render_data = ExportDocumentRenderData(string)
upload_cloud_render_data = UploadRenderData(export_cloud_render_data)
number = DoubleInput(640)
number_2 = DoubleInput(480)
renderType = RenderTypeDropDown(index=4)
renderQuality = RenderQualityDropDown(index=3)
byViewNameWidthHeight = Analyze.Render.CloudRenderingJob.ByViewNameWidthHeight(string, number, number_2, renderType, renderQuality, lacing=Longest)
boolean = BoolSelector(false)
do_cloud_render = CloudRender(upload_cloud_render_data, byViewNameWidthHeight, boolean)
firstItem = List.FirstItem(do_cloud_render)
readImage = File.ReadImage(firstItem, number, number_2)
