# Dynamo graph TranslateandRotatesequence.dyn (Dynamo 0.6.2.14024)

XYZ = Xyz(lacing=Longest)
z_axis = XyzBasisZ(lacing=Longest)
number = DoubleInput(0.1)
number_slider = DoubleSliderInput(6.24, range=0..6.24)
number_2 = DoubleInput(0.25)
number_range = NumberRange(number, number_slider, number_2, lacing=Longest)
rotate_transform = TransformRotation(XYZ, z_axis, number_range, lacing=Longest)
x_axis = XyzBasisX(lacing=Longest)
scale_xyz = XyzScale(x_axis, number_range, lacing=Longest)
transform_xyz = TransformPoint(rotate_transform, scale_xyz, lacing=Longest)
line_by_endpoints = LineBound(XYZ, transform_xyz, lacing=Longest)
watch_3d = Watch3D(line_by_endpoints)
watch = Watch(number_range)
