# Dynamo graph createpoint_sequence.dyn (Dynamo 0.6.2.14024)

number = DoubleInput(0)
number_slider = DoubleSliderInput(80, range=0..100)
number_2 = DoubleInput(10)
number_range = NumberRange(number, number_slider, number_2, lacing=Longest)
XYZ = Xyz(number, number, number_range, lacing=Longest)
reference_point = ReferencePointByXyz(XYZ, lacing=Longest)
number_3 = DoubleInput(0..80..10)
watch = Watch(number_3)
