# Dynamo graph hill_climbing_daylighting.dyn (Dynamo 0.6.3.16460)

number = DoubleInput(1)
number_2 = DoubleInput(20)
list = NewList(index0=number, index1=number_2)
string = StringInput("Width")
list_2 = NewList(index0=list, index1=string)
number_3 = DoubleInput(1)
number_4 = DoubleInput(20)
list_3 = NewList(index0=number_3, index1=number_4)
string_2 = StringInput("Height")
list_4 = NewList(index0=list_3, index1=string_2)
list_5 = NewList(index0=list_2, index1=list_4)
number_5 = DoubleInput(0)
select_family_type = FamilyTypeSelector(index=66)
get_family_instances_by_type = GetFamilyInstancesByType(select_family_type)
make_daylight_param_parent = Custom[Make Daylight param parent vector](list_of_parameters_and_ranges=list_5, generation_number=number_5, list_of_family_instances=get_family_instances_by_type)
evaluate_daylighting_solution = Custom[Evaluate Daylighting Solution](solution=make_daylight_param_parent)
number_6 = DoubleInput(10)
produce_new_daylight_child = Custom[Produce New DayLight Child](parent_fit=evaluate_daylighting_solution, family_instances=get_family_instances_by_type, parent=make_daylight_param_parent, mutation_rate=number_6)
watch = Watch(produce_new_daylight_child)
watch_2 = Watch(evaluate_daylighting_solution)
watch_3 = Watch(make_daylight_param_parent)
