# Dynamo graph instparam.dyn (Dynamo 0.6.2.14024)

select_family_instance = FamilyInstanceCreatorSelection()  # 1 picked in the model
get_family_parameter = FamilyInstanceParameterSelector(select_family_instance)
get_family_instance_parameter = FamilyInstanceParameterGetter(select_family_instance, get_family_parameter, lacing=Longest)  # "Get Family Instance Parameter Value"
watch = Watch(get_family_instance_parameter)
