# Dynamo graph refgridsliders.dyn (Dynamo 0.6.2.14024)

number_slider = DoubleSliderInput(5.955, range=0..10)
number = DoubleInput(1)
number_2 = DoubleInput(0)
number_slider_2 = DoubleSliderInput(30, range=0..50)
number_slider_3 = DoubleSliderInput(19, range=0..50)
number_3 = DoubleInput(0)
xyz_grid = ReferencePtGrid(number_slider, number_slider, number, number_2, number_2, number_2, number_slider_2, number_slider_3, number_3, lacing=Longest)
reference_point = ReferencePointByXyz(xyz_grid, lacing=Longest)
