# Dynamo graph SolidBySkeleton.dyn

number = DoubleInput(50)
number_2 = DoubleInput(0)
XYZ = XYZ(number, number_2, number_2, lacing=Longest)
XYZ_2 = XYZ(number, number, number_2, lacing=Longest)
line = LineBound(XYZ, XYZ_2, lacing=Longest)
XYZ_3 = XYZ(number_2, number, number_2, lacing=Longest)
line_2 = LineBound(XYZ_2, XYZ_3, lacing=Longest)
number_3 = DoubleInput(100)
XYZ_4 = XYZ(number_3, number_3, number_2, lacing=Longest)
line_3 = LineBound(XYZ_3, XYZ_4, lacing=Longest)
line_4 = LineBound(XYZ_4, XYZ, lacing=Longest)
list = NewList(index0=line, index1=line_2, index2=line_3, index3=line_4)
curve_loop = CurveLoop(list, lacing=Longest)
number_4 = DoubleInput(75)
XYZ_5 = XYZ(number_4, number_4, number_3, lacing=Longest)
line_5 = LineBound(XYZ, XYZ_5, lacing=Longest)
line_6 = LineBound(XYZ_2, XYZ_5, lacing=Longest)
list_2 = NewList(index0=line, index1=line_5, index2=line_6)
curve_loop_2 = CurveLoop(list_2, lacing=Longest)
line_7 = LineBound(XYZ_3, XYZ_5, lacing=Longest)
list_3 = NewList(index0=line_2, index1=line_6, index2=line_7)
curve_loop_3 = CurveLoop(list_3, lacing=Longest)
line_8 = LineBound(XYZ_4, XYZ_5, lacing=Longest)
list_4 = NewList(index0=line_3, index1=line_7, index2=line_8)
curve_loop_4 = CurveLoop(list_4, lacing=Longest)
list_5 = NewList(index0=line_4, index1=line_5, index2=line_8)
curve_loop_5 = CurveLoop(list_5, lacing=Longest)
list_6 = NewList(index0=curve_loop, index1=curve_loop_2, index2=curve_loop_3, index3=curve_loop_4, index4=curve_loop_5)
solid_on_curve_loops = SkinCurveLoops(list_6, lacing=Longest)
watch = Watch(solid_on_curve_loops)
