# Dynamo graph Column.dyn (Dynamo 0.7.2.34787)

code_block = CodeBlock { Point.ByCoordinates(0,0,0); Point.ByCoordinates(0,0,20); 20; 10; }
byCenterPointRadius = Circle.ByCenterPointRadius(code_block.out0, code_block.out2)
code_block_2 = CodeBlock { 0..1..#10; }
pointAtParameter = Curve.PointAtParameter(byCenterPointRadius, code_block_2)
byCenterPointRadius_2 = Circle.ByCenterPointRadius(code_block.out1, code_block.out3)
pointAtParameter_2 = Curve.PointAtParameter(byCenterPointRadius_2, code_block_2)
byStartPointEndPoint = Line.ByStartPointEndPoint(pointAtParameter, pointAtParameter_2)
levels = Levels("Level 1")
structural_framing_types = StructuralFramingTypes("W12X26")
columnByCurve = StructuralFraming.ColumnByCurve(byStartPointEndPoint, levels, structural_framing_types)
