# Dynamo graph Brace.dyn (Dynamo 0.7.2.2921)

code_block = CodeBlock { Point.ByCoordinates(0,0,0); Point.ByCoordinates(0,0,20); 20; 10; }
byCenterPointRadius = Circle.ByCenterPointRadius(code_block.out0, code_block.out2)
integer_slider = IntegerSlider(14, range=0..100)
code_block_2 = CodeBlock(count=integer_slider) { 0..0.9..#count; }
pointAtParameter = Curve.PointAtParameter(byCenterPointRadius, code_block_2)
byCenterPointRadius_2 = Circle.ByCenterPointRadius(code_block.out1, code_block.out3)
pointAtParameter_2 = Curve.PointAtParameter(byCenterPointRadius_2, code_block_2)
byStartPointEndPoint = Line.ByStartPointEndPoint(pointAtParameter, pointAtParameter_2)
levels = Levels("Level 1")
structural_framing_types = StructuralFramingTypes("HSS20X0.500")
braceByCurve = StructuralFraming.BraceByCurve(byStartPointEndPoint, levels, structural_framing_types)
