# Dynamo graph DraftingView.dyn

concat_strings = ConcatStrings()
string = StringInput("view")
list = NewList(index0=string)
number = DoubleInput(0..10)
number_to_string = Num2String(number, lacing=Longest)
cartesian_product = CartProd(concat_strings, list, number_to_string)
watch = Watch(cartesian_product)
drafting_view = DraftingView(cartesian_product, lacing=Longest)
