# Dynamo graph ExportImage.dyn (Dynamo 0.7.5.3261)

views = Views("Level 1")
string = StringInput("c:\Users\Ian\Desktop\imageTest_1.png")
exportAsImage = View.ExportAsImage(views, string)
views_2 = Views("{3D}")
string_2 = StringInput("c:\Users\Ian\Desktop\imageTest_2.png")
exportAsImage_2 = View.ExportAsImage(views_2, string_2)
