# Dynamo graph XYZToPolarCoordinates.dyn (Dynamo 0.6.2.17383)

number = DoubleInput(2)
number_2 = DoubleInput(1.2)
number_3 = DoubleInput(3)
xyz_by_polar_coordinates = XyzFromPolar(number, number_2, number_3, lacing=Longest)
xyz_to_polar_coordinates = XyzToPolar(xyz_by_polar_coordinates, lacing=Longest)
