# Dynamo graph MAGN-3488.dyn (Dynamo 0.7.5.3346)

select_model_element = DSModelElementSelection()  # 1 picked in the model
code_block = CodeBlock { "H"; }
select_model_element_2 = DSModelElementSelection()  # 1 picked in the model
getParameterValueByName = Element.GetParameterValueByName(select_model_element_2, code_block, lacing=Longest)
setParameterByName = Element.SetParameterByName(select_model_element, code_block, getParameterValueByName, lacing=Longest)
watch = Watch(getParameterValueByName)
