# Dynamo graph BiggestRectangle.dyn "BiggestRectangle_001" (Dynamo 2.13.1.3887)
# test_backwardsrecursive
# packages: LunchBox for Dynamo 2016.11.11, GenerativeDesign 2.0.10.0

select_model_elements = DSModelElementsSelection()  # 7 picked in the model
geometry = Element.Geometry(element=select_model_elements)
remember = Data.Remember(geometry)
code_block = CodeBlock { 0; }
getItemAtIndex = List.GetItemAtIndex(list=remember, index=code_block)
startPoint = Curve.StartPoint(curve=getItemAtIndex)
byPoints = Polygon.ByPoints(points=startPoint)
byPatch = Surface.ByPatch(closedCurve=byPoints)
perimeterCurves = Surface.PerimeterCurves(surface=byPatch)
byJoinedCurves = PolyCurve.ByJoinedCurves(curves=perimeterCurves)
select_model_elements_2 = DSModelElementsSelection()  # 25 picked in the model
setDifference = List.SetDifference(list1=select_model_elements_2, list2=select_model_elements)
geometry_2 = Element.Geometry(element=setDifference)
remember_2 = Data.Remember(geometry_2)
intersect = Geometry.Intersect(geometry=byJoinedCurves, other=remember_2)
point_Entrances = List.Flatten(list=intersect)
lines_Entrances = List.Flatten(list=remember_2)
list_create = List.Create(item0=point_Entrances, item1=lines_Entrances)
transpose = List.Transpose(lists=list_create)
kavelEntry_001_input = IntegerSlider(8, range=0..17 step 1)  # graph input
getItemAtIndex_2 = List.GetItemAtIndex(list=transpose, index=kavelEntry_001_input)
kavelEntry_002_input = IntegerSlider(16, range=0..17 step 1)  # graph input
getItemAtIndex_3 = List.GetItemAtIndex(list=transpose, index=kavelEntry_002_input)
list_create_2 = List.Create(item0=getItemAtIndex_2, item1=getItemAtIndex_3)
join = List.Join(list0=kavelEntry_001_input, list1=kavelEntry_002_input)
removeItemAtIndex = List.RemoveItemAtIndex(list=transpose, indices=join)
seed = IntegerSlider(16, range=0..40 step 1)  # graph input
shuffle = List.Shuffle(list=removeItemAtIndex, seed=seed)
aantalAansluitingen = IntegerSlider(4, range=0..14 step 1)  # graph input
takeItems = List.TakeItems(list=shuffle, amount=aantalAansluitingen)
join_2 = List.Join(list0=list_create_2, list1=takeItems)

# group: BackwardsRecursive
empty = List.Empty()
boolean = BoolSelector(true)
code_block_2 = CodeBlock { 0; }
getItemAtIndex_4 = List.GetItemAtIndex(list=join_2@L2, index=code_block_2)
count = List.Count(list=getItemAtIndex_4)
code_block_3 = CodeBlock { 2; }
eq = count == code_block_3
byStartPointEndPoint = Line.ByStartPointEndPoint(startPoint=getItemAtIndex_4)  # unwired: endPoint
map = List.Map(list=getItemAtIndex_4, function=byStartPointEndPoint)
flatten = List.Flatten(list=map)
isNull = Object.IsNull(object=flatten)
code_block_4 = CodeBlock { false; }
allIndicesOf = List.AllIndicesOf(list=isNull, item=code_block_4)
getItemAtIndex_5 = List.GetItemAtIndex(list=flatten, index=allIndicesOf)
length = Curve.Length(curve=getItemAtIndex_5)
sort = List.Sort(list=length)
lastItem = List.LastItem(list=sort)
indexOf = List.IndexOf(list=length, element=lastItem)
getItemAtIndex_6 = List.GetItemAtIndex(list=getItemAtIndex_5, index=indexOf)
doesIntersect = Geometry.DoesIntersect(geometry=getItemAtIndex_4, other=getItemAtIndex_6)
filterByBoolMask = List.FilterByBoolMask(list=getItemAtIndex_4, mask=doesIntersect)
indexOf_2 = List.IndexOf(list=getItemAtIndex_4, element=filterByBoolMask.in)
removeItemAtIndex_2 = List.RemoveItemAtIndex(list=join_2, indices=indexOf_2)
code_block_5 = CodeBlock { 0; }
getItemAtIndex_7 = List.GetItemAtIndex(list=removeItemAtIndex_2@L2, index=code_block_5)
code_block_6 = CodeBlock { 1; }
getItemAtIndex_8 = List.GetItemAtIndex(list=removeItemAtIndex_2@L2, index=code_block_6)
number = DoubleInput(1000000)
extendEnd = Curve.ExtendEnd(curve=getItemAtIndex_8, distance=number)
doesIntersect_2 = Geometry.DoesIntersect(geometry=getItemAtIndex_6, other=extendEnd)
code_block_7 = CodeBlock { false; }
allIndicesOf_2 = List.AllIndicesOf(list=doesIntersect_2, item=code_block_7)
getItemAtIndex_9 = List.GetItemAtIndex(list=getItemAtIndex_7, index=allIndicesOf_2)
getItemAtIndex_10 = List.GetItemAtIndex(list=extendEnd, index=allIndicesOf_2)
startPoint_2 = Curve.StartPoint(curve=getItemAtIndex_10)
endPoint = Curve.EndPoint(curve=getItemAtIndex_10)
byTwoPoints = Vector.ByTwoPoints(start=startPoint_2, end=endPoint)
code_block_8 = CodeBlock { 10; }
translate = Geometry.Translate(geometry=getItemAtIndex_9, direction=byTwoPoints, distance=code_block_8)
project = Point.Project(point=translate, baseGeometry=byJoinedCurves, projectionDirection=byTwoPoints)
byStartPointEndPoint_2 = Line.ByStartPointEndPoint(startPoint=getItemAtIndex_9, endPoint=project)
removeItemAtIndex_3 = List.RemoveItemAtIndex(list=getItemAtIndex_7, indices=allIndicesOf_2)
removeItemAtIndex_4 = List.RemoveItemAtIndex(list=extendEnd, indices=allIndicesOf_2)
intersect_2 = Geometry.Intersect(geometry=getItemAtIndex_6, other=removeItemAtIndex_4)
byStartPointEndPoint_3 = Line.ByStartPointEndPoint(startPoint=removeItemAtIndex_3, endPoint=intersect_2)
flatten_2 = List.Flatten(list=byStartPointEndPoint_3)
list_create_3 = List.Create(item0=byStartPointEndPoint_2, item1=flatten_2)
flatten_3 = List.Flatten(list=list_create_3)
isEmpty = List.IsEmpty(list=getItemAtIndex_10)
code_block_9 = CodeBlock(a=flatten_3, b=flatten_2, x=isEmpty) { choice=[a,b]; choice[x?1:0]; }
intersect_3 = Geometry.Intersect(other=code_block_9.out1)  # unwired: geometry
# note: Vindt alle kruispunten
map_2 = List.Map(list=code_block_9.out1, function=intersect_3)
flatten_4 = List.Flatten(list=map_2)
string_from_object = FromObject(object=flatten_4)
code_block_10 = CodeBlock { "Line"; }
contains = String.Contains(string=string_from_object, searchFor=code_block_10)
filterByBoolMask_2 = List.FilterByBoolMask(list=flatten_4, mask=contains)
pruneDuplicates = Point.PruneDuplicates(points=filterByBoolMask_2.out)
doesIntersect_3 = Geometry.DoesIntersect(geometry=filterByBoolMask_2.in, other=pruneDuplicates, lacing=CrossProduct)
code_block_11 = CodeBlock { true; }
allIndicesOf_3 = List.AllIndicesOf(item=code_block_11)  # unwired: list
map_3 = List.Map(list=doesIntersect_3, function=allIndicesOf_3)
count_2 = List.Count(list=map_3@L2)
code_block_12 = CodeBlock { 0; }
eq_2 = count_2 == code_block_12
allTrue = List.AllTrue(list=eq_2)
flatten_5 = List.Flatten(list=filterByBoolMask_2.in@L1)
flatten_6 = List.Flatten(list=count_2@L1)
getItemAtIndex_11 = List.GetItemAtIndex(list=pruneDuplicates, index=map_3)
list_create_4 = List.Create(item0=flatten_5, item1=flatten_6, item2=getItemAtIndex_11)
transpose_2 = List.Transpose(lists=list_create_4)
code_block_13 = CodeBlock { 3; }
ge = count_2 >= code_block_13
code_block_14 = CodeBlock { true; }
allIndicesOf_4 = List.AllIndicesOf(list=ge, item=code_block_14)
getItemAtIndex_12 = List.GetItemAtIndex(list=transpose_2, index=allIndicesOf_4)
code_block_15 = CodeBlock { 0; 2; }
getItemAtIndex_13 = List.GetItemAtIndex(list=getItemAtIndex_12@L3, index=code_block_15.out0)
flatten_7 = List.Flatten(list=getItemAtIndex_13)
startPoint_3 = Curve.StartPoint(curve=getItemAtIndex_13)
getItemAtIndex_14 = List.GetItemAtIndex(list=getItemAtIndex_12@L3, index=code_block_15.out1)
flatten_8 = List.Flatten(list=startPoint_3)
distanceTo = Geometry.DistanceTo(geometry=getItemAtIndex_14, other=flatten_8, lacing=Shortest)
sort_2 = List.Sort(list=distanceTo@L2)
code_block_16 = CodeBlock { 0; }
getItemAtIndex_15 = List.GetItemAtIndex(list=sort_2@L2, index=code_block_16)
indexOf_3 = List.IndexOf(list=distanceTo@L2, element=getItemAtIndex_15, lacing=Shortest)
getItemAtIndex_16 = List.GetItemAtIndex(list=getItemAtIndex_14@L2, index=indexOf_3@L1)
byStartPointEndPoint_4 = Line.ByStartPointEndPoint(startPoint=startPoint_3, endPoint=getItemAtIndex_16)
flatten_9 = List.Flatten(list=byStartPointEndPoint_4)
endPoint_2 = Curve.EndPoint(curve=flatten_9)
doesIntersect_4 = Geometry.DoesIntersect(geometry=endPoint_2, other=flatten_9, lacing=CrossProduct)
countTrue = List.CountTrue(list=doesIntersect_4@L2)
code_block_17 = CodeBlock { 2; }
allIndicesOf_5 = List.AllIndicesOf(list=countTrue, item=code_block_17)
removeItemAtIndex_5 = List.RemoveItemAtIndex(list=flatten_7, indices=allIndicesOf_5)
getItemAtIndex_17 = List.GetItemAtIndex(list=flatten_7, index=allIndicesOf_5)
getItemAtIndex_18 = List.GetItemAtIndex(list=flatten_9, index=allIndicesOf_5)
intersect_4 = Geometry.Intersect(other=getItemAtIndex_18)  # unwired: geometry
map_4 = List.Map(list=getItemAtIndex_18, function=intersect_4)
flatten_10 = List.Flatten(list=map_4)
string_from_object_2 = FromObject(object=flatten_10)
code_block_18 = CodeBlock { "Line"; }
contains_2 = String.Contains(string=string_from_object_2, searchFor=code_block_18)
code_block_19 = CodeBlock { false; }
allIndicesOf_6 = List.AllIndicesOf(list=contains_2, item=code_block_19)
getItemAtIndex_19 = List.GetItemAtIndex(list=flatten_10, index=allIndicesOf_6)
pruneDuplicates_2 = Point.PruneDuplicates(points=getItemAtIndex_19)
count_3 = List.Count(list=pruneDuplicates_2)
cycle = List.Cycle(list=getItemAtIndex_17, amount=count_3)
count_4 = List.Count(list=getItemAtIndex_18)
chop = List.Chop(list=cycle, lengths=count_4)
doesIntersect_5 = Geometry.DoesIntersect(geometry=pruneDuplicates_2, other=getItemAtIndex_18, lacing=CrossProduct)
code_block_20 = CodeBlock { true; }
allIndicesOf_7 = List.AllIndicesOf(list=doesIntersect_5@L2, item=code_block_20)
getItemAtIndex_20 = List.GetItemAtIndex(list=chop@L2, index=allIndicesOf_7@L2)
length_2 = Curve.Length(curve=getItemAtIndex_20@L2)
sort_3 = List.Sort(list=length_2@L2)
firstItem = List.FirstItem(list=sort_3@L2)
indexOf_4 = List.IndexOf(list=length_2@L2, element=firstItem@L1, lacing=Shortest)
getItemAtIndex_21 = List.GetItemAtIndex(list=getItemAtIndex_20@L2, index=indexOf_4@L1)
removeItemAtIndex_6 = List.RemoveItemAtIndex(list=transpose_2, indices=allIndicesOf_4)
code_block_21 = CodeBlock { 0; }
getItemAtIndex_22 = List.GetItemAtIndex(list=removeItemAtIndex_6@L3, index=code_block_21)
list_create_5 = List.Create(item0=removeItemAtIndex_5, item1=getItemAtIndex_21, item2=getItemAtIndex_22)
flatten_11 = List.Flatten(list=list_create_5)
isNull_2 = Object.IsNull(object=flatten_11)
code_block_22 = CodeBlock { false; }
allIndicesOf_8 = List.AllIndicesOf(list=isNull_2, item=code_block_22)
getItemAtIndex_23 = List.GetItemAtIndex(list=flatten_11, index=allIndicesOf_8)
intersect_5 = Geometry.Intersect(other=getItemAtIndex_23)  # unwired: geometry
map_5 = List.Map(list=getItemAtIndex_23, function=intersect_5)
flatten_12 = List.Flatten(list=map_5)
string_from_object_3 = FromObject(object=flatten_12)
code_block_23 = CodeBlock { "Line"; }
contains_3 = String.Contains(string=string_from_object_3, searchFor=code_block_23)
filterByBoolMask_3 = List.FilterByBoolMask(list=flatten_12, mask=contains_3)
flatten_13 = List.Flatten(list=filterByBoolMask_3.in@L1)
pruneDuplicates_3 = Point.PruneDuplicates(points=filterByBoolMask_3.out)
doesIntersect_6 = Geometry.DoesIntersect(geometry=filterByBoolMask_3.in, other=pruneDuplicates_3, lacing=CrossProduct)
code_block_24 = CodeBlock { true; }
allIndicesOf_9 = List.AllIndicesOf(item=code_block_24)  # unwired: list
map_6 = List.Map(list=doesIntersect_6, function=allIndicesOf_9)
count_5 = List.Count(list=map_6@L2)
flatten_14 = List.Flatten(list=count_5@L1)
getItemAtIndex_24 = List.GetItemAtIndex(list=pruneDuplicates_3, index=map_6)
list_create_6 = List.Create(item0=flatten_13, item1=flatten_14, item2=getItemAtIndex_24)
transpose_3 = List.Transpose(lists=list_create_6)
code_block_25 = CodeBlock { 1; }
ge_2 = count_5 >= code_block_25
code_block_26 = CodeBlock { true; }
allIndicesOf_10 = List.AllIndicesOf(list=ge_2, item=code_block_26)
getItemAtIndex_25 = List.GetItemAtIndex(list=transpose_3, index=allIndicesOf_10)
code_block_27 = CodeBlock { 0; 2; }
getItemAtIndex_26 = List.GetItemAtIndex(list=getItemAtIndex_25@L3, index=code_block_27.out0)
flatten_15 = List.Flatten(list=getItemAtIndex_26)
startPoint_4 = Curve.StartPoint(curve=getItemAtIndex_26)
getItemAtIndex_27 = List.GetItemAtIndex(list=getItemAtIndex_25@L3, index=code_block_27.out1)
flatten_16 = List.Flatten(list=startPoint_4)
distanceTo_2 = Geometry.DistanceTo(geometry=getItemAtIndex_27, other=flatten_16, lacing=Shortest)
sort_4 = List.Sort(list=distanceTo_2@L2)
code_block_28 = CodeBlock { 0; }
getItemAtIndex_28 = List.GetItemAtIndex(list=sort_4@L2, index=code_block_28)
indexOf_5 = List.IndexOf(list=distanceTo_2@L2, element=getItemAtIndex_28, lacing=Shortest)
getItemAtIndex_29 = List.GetItemAtIndex(list=getItemAtIndex_27@L2, index=indexOf_5@L1)
byStartPointEndPoint_5 = Line.ByStartPointEndPoint(startPoint=startPoint_4, endPoint=getItemAtIndex_29)
flatten_17 = List.Flatten(list=byStartPointEndPoint_5)
endPoint_3 = Curve.EndPoint(curve=flatten_17)
doesIntersect_7 = Geometry.DoesIntersect(geometry=endPoint_3, other=flatten_17, lacing=CrossProduct)
countTrue_2 = List.CountTrue(list=doesIntersect_7@L2)
code_block_29 = CodeBlock { 2; }
allIndicesOf_11 = List.AllIndicesOf(list=countTrue_2, item=code_block_29)
removeItemAtIndex_7 = List.RemoveItemAtIndex(list=flatten_15, indices=allIndicesOf_11)
getItemAtIndex_30 = List.GetItemAtIndex(list=flatten_15, index=allIndicesOf_11)
getItemAtIndex_31 = List.GetItemAtIndex(list=flatten_17, index=allIndicesOf_11)
intersect_6 = Geometry.Intersect(other=getItemAtIndex_31)  # unwired: geometry
map_7 = List.Map(list=getItemAtIndex_31, function=intersect_6)
flatten_18 = List.Flatten(list=map_7)
string_from_object_4 = FromObject(object=flatten_18)
code_block_30 = CodeBlock { "Line"; }
contains_4 = String.Contains(string=string_from_object_4, searchFor=code_block_30)
code_block_31 = CodeBlock { false; }
allIndicesOf_12 = List.AllIndicesOf(list=contains_4, item=code_block_31)
getItemAtIndex_32 = List.GetItemAtIndex(list=flatten_18, index=allIndicesOf_12)
pruneDuplicates_4 = Point.PruneDuplicates(points=getItemAtIndex_32)
count_6 = List.Count(list=pruneDuplicates_4)
cycle_2 = List.Cycle(list=getItemAtIndex_30, amount=count_6)
count_7 = List.Count(list=getItemAtIndex_31)
chop_2 = List.Chop(list=cycle_2, lengths=count_7)
doesIntersect_8 = Geometry.DoesIntersect(geometry=pruneDuplicates_4, other=getItemAtIndex_31, lacing=CrossProduct)
code_block_32 = CodeBlock { true; }
allIndicesOf_13 = List.AllIndicesOf(list=doesIntersect_8@L2, item=code_block_32)
getItemAtIndex_33 = List.GetItemAtIndex(list=chop_2@L2, index=allIndicesOf_13@L2)
length_3 = Curve.Length(curve=getItemAtIndex_33@L2)
sort_5 = List.Sort(list=length_3@L2)
firstItem_2 = List.FirstItem(list=sort_5@L2)
indexOf_6 = List.IndexOf(list=length_3@L2, element=firstItem_2@L1, lacing=Shortest)
getItemAtIndex_34 = List.GetItemAtIndex(list=getItemAtIndex_33@L2, index=indexOf_6@L1)
removeItemAtIndex_8 = List.RemoveItemAtIndex(list=transpose_3, indices=allIndicesOf_10)
code_block_33 = CodeBlock { 0; }
getItemAtIndex_35 = List.GetItemAtIndex(list=removeItemAtIndex_8@L3, index=code_block_33)
list_create_7 = List.Create(item0=removeItemAtIndex_7, item1=getItemAtIndex_34, item2=getItemAtIndex_35)
flatten_19 = List.Flatten(list=list_create_7)
isNull_3 = Object.IsNull(object=flatten_19)
code_block_34 = CodeBlock { false; }
allIndicesOf_14 = List.AllIndicesOf(list=isNull_3, item=code_block_34)
getItemAtIndex_36 = List.GetItemAtIndex(list=flatten_19, index=allIndicesOf_14)
intersect_7 = Geometry.Intersect(other=getItemAtIndex_36)  # unwired: geometry
map_8 = List.Map(list=getItemAtIndex_36, function=intersect_7)
flatten_20 = List.Flatten(list=map_8)
string_from_object_5 = FromObject(object=flatten_20)
code_block_35 = CodeBlock { "Line"; }
contains_5 = String.Contains(string=string_from_object_5, searchFor=code_block_35)
filterByBoolMask_4 = List.FilterByBoolMask(list=flatten_20, mask=contains_5)
pruneDuplicates_5 = Point.PruneDuplicates(points=filterByBoolMask_4.out)
doesIntersect_9 = Geometry.DoesIntersect(geometry=filterByBoolMask_4.in, other=pruneDuplicates_5, lacing=CrossProduct)
code_block_36 = CodeBlock { true; }
allIndicesOf_15 = List.AllIndicesOf(item=code_block_36)  # unwired: list
map_9 = List.Map(list=doesIntersect_9, function=allIndicesOf_15)
count_8 = List.Count(list=map_9@L2)
code_block_37 = CodeBlock { 0; }
eq_3 = count_8 == code_block_37
allTrue_2 = List.AllTrue(list=eq_3)
flatten_21 = List.Flatten(list=filterByBoolMask_4.in@L1)
flatten_22 = List.Flatten(list=count_8@L1)
getItemAtIndex_37 = List.GetItemAtIndex(list=pruneDuplicates_5, index=map_9)
list_create_8 = List.Create(item0=flatten_21, item1=flatten_22, item2=getItemAtIndex_37)
transpose_4 = List.Transpose(lists=list_create_8)
code_block_38 = CodeBlock { 1; }
ge_3 = count_8 >= code_block_38
code_block_39 = CodeBlock { true; }
allIndicesOf_16 = List.AllIndicesOf(list=ge_3, item=code_block_39)
getItemAtIndex_38 = List.GetItemAtIndex(list=transpose_4, index=allIndicesOf_16)
code_block_40 = CodeBlock { 0; 2; }
getItemAtIndex_39 = List.GetItemAtIndex(list=getItemAtIndex_38@L3, index=code_block_40.out0)
flatten_23 = List.Flatten(list=getItemAtIndex_39)
startPoint_5 = Curve.StartPoint(curve=getItemAtIndex_39)
getItemAtIndex_40 = List.GetItemAtIndex(list=getItemAtIndex_38@L3, index=code_block_40.out1)
flatten_24 = List.Flatten(list=startPoint_5)
distanceTo_3 = Geometry.DistanceTo(geometry=getItemAtIndex_40, other=flatten_24, lacing=Shortest)
sort_6 = List.Sort(list=distanceTo_3@L2)
code_block_41 = CodeBlock { 0; }
getItemAtIndex_41 = List.GetItemAtIndex(list=sort_6@L2, index=code_block_41)
indexOf_7 = List.IndexOf(list=distanceTo_3@L2, element=getItemAtIndex_41, lacing=Shortest)
getItemAtIndex_42 = List.GetItemAtIndex(list=getItemAtIndex_40@L2, index=indexOf_7@L1)
byStartPointEndPoint_6 = Line.ByStartPointEndPoint(startPoint=startPoint_5, endPoint=getItemAtIndex_42)
flatten_25 = List.Flatten(list=byStartPointEndPoint_6)
endPoint_4 = Curve.EndPoint(curve=flatten_25)
doesIntersect_10 = Geometry.DoesIntersect(geometry=endPoint_4, other=flatten_25, lacing=CrossProduct)
countTrue_3 = List.CountTrue(list=doesIntersect_10@L2)
code_block_42 = CodeBlock { 2; }
allIndicesOf_17 = List.AllIndicesOf(list=countTrue_3, item=code_block_42)
removeItemAtIndex_9 = List.RemoveItemAtIndex(list=flatten_23, indices=allIndicesOf_17)
getItemAtIndex_43 = List.GetItemAtIndex(list=flatten_23, index=allIndicesOf_17)
getItemAtIndex_44 = List.GetItemAtIndex(list=flatten_25, index=allIndicesOf_17)
intersect_8 = Geometry.Intersect(other=getItemAtIndex_44)  # unwired: geometry
map_10 = List.Map(list=getItemAtIndex_44, function=intersect_8)
flatten_26 = List.Flatten(list=map_10)
string_from_object_6 = FromObject(object=flatten_26)
code_block_43 = CodeBlock { "Line"; }
contains_6 = String.Contains(string=string_from_object_6, searchFor=code_block_43)
code_block_44 = CodeBlock { false; }
allIndicesOf_18 = List.AllIndicesOf(list=contains_6, item=code_block_44)
getItemAtIndex_45 = List.GetItemAtIndex(list=flatten_26, index=allIndicesOf_18)
pruneDuplicates_6 = Point.PruneDuplicates(points=getItemAtIndex_45)
count_9 = List.Count(list=pruneDuplicates_6)
cycle_3 = List.Cycle(list=getItemAtIndex_43, amount=count_9)
count_10 = List.Count(list=getItemAtIndex_44)
chop_3 = List.Chop(list=cycle_3, lengths=count_10)
doesIntersect_11 = Geometry.DoesIntersect(geometry=pruneDuplicates_6, other=getItemAtIndex_44, lacing=CrossProduct)
code_block_45 = CodeBlock { true; }
allIndicesOf_19 = List.AllIndicesOf(list=doesIntersect_11@L2, item=code_block_45)
getItemAtIndex_46 = List.GetItemAtIndex(list=chop_3@L2, index=allIndicesOf_19@L2)
length_4 = Curve.Length(curve=getItemAtIndex_46@L2)
sort_7 = List.Sort(list=length_4@L2)
firstItem_3 = List.FirstItem(list=sort_7@L2)
indexOf_8 = List.IndexOf(list=length_4@L2, element=firstItem_3@L1, lacing=Shortest)
getItemAtIndex_47 = List.GetItemAtIndex(list=getItemAtIndex_46@L2, index=indexOf_8@L1)
removeItemAtIndex_10 = List.RemoveItemAtIndex(list=transpose_4, indices=allIndicesOf_16)
code_block_46 = CodeBlock { 0; }
getItemAtIndex_48 = List.GetItemAtIndex(list=removeItemAtIndex_10@L3, index=code_block_46)
list_create_9 = List.Create(item0=removeItemAtIndex_9, item1=getItemAtIndex_47, item2=getItemAtIndex_48)
flatten_27 = List.Flatten(list=list_create_9)
isNull_4 = Object.IsNull(object=flatten_27)
code_block_47 = CodeBlock { false; }
allIndicesOf_20 = List.AllIndicesOf(list=isNull_4, item=code_block_47)
getItemAtIndex_49 = List.GetItemAtIndex(list=flatten_27, index=allIndicesOf_20)
intersect_9 = Geometry.Intersect(other=getItemAtIndex_49)  # unwired: geometry
map_11 = List.Map(list=getItemAtIndex_49, function=intersect_9)
flatten_28 = List.Flatten(list=map_11)
string_from_object_7 = FromObject(object=flatten_28)
code_block_48 = CodeBlock { "Line"; }
contains_7 = String.Contains(string=string_from_object_7, searchFor=code_block_48)
filterByBoolMask_5 = List.FilterByBoolMask(list=flatten_28, mask=contains_7)
pruneDuplicates_7 = Point.PruneDuplicates(points=filterByBoolMask_5.out)
doesIntersect_12 = Geometry.DoesIntersect(geometry=filterByBoolMask_5.in, other=pruneDuplicates_7, lacing=CrossProduct)
code_block_49 = CodeBlock { true; }
allIndicesOf_21 = List.AllIndicesOf(item=code_block_49)  # unwired: list
map_12 = List.Map(list=doesIntersect_12, function=allIndicesOf_21)
count_11 = List.Count(list=map_12@L2)
code_block_50 = CodeBlock { 0; }
eq_4 = count_11 == code_block_50
allTrue_3 = List.AllTrue(list=eq_4)
join_3 = List.Join(list0=eq, list1=allTrue, list2=allTrue_2, list3=allTrue_3)
code_block_51 = CodeBlock { 0; 1; 2; 3; }
getItemAtIndex_50 = List.GetItemAtIndex(list=join_3, index=code_block_51.out0)
eq_5 = boolean == getItemAtIndex_50
getItemAtIndex_51 = List.GetItemAtIndex(list=join_3, index=code_block_51.out1)
eq_6 = boolean == getItemAtIndex_51
getItemAtIndex_52 = List.GetItemAtIndex(list=join_3, index=code_block_51.out2)
eq_7 = boolean == getItemAtIndex_52
getItemAtIndex_53 = List.GetItemAtIndex(list=join_3, index=code_block_51.out3)
eq_8 = boolean == getItemAtIndex_53
join_4 = List.Join(list0=eq_5, list1=eq_6, list2=eq_7, list3=eq_8)
allTrue_4 = List.AllTrue(list=join_4)
code_block_52 = CodeBlock(a=empty, b=empty, x=allTrue_4) { choice=[a,b]; choice[x?1:0]; }
flatten_29 = List.Flatten(list=code_block_9.out1)
boolean_2 = BoolSelector(false)
eq_9 = boolean_2 == getItemAtIndex_50
eq_10 = boolean == getItemAtIndex_51
eq_11 = boolean == getItemAtIndex_52
eq_12 = boolean == getItemAtIndex_53
join_5 = List.Join(list0=eq_9, list1=eq_10, list2=eq_11, list3=eq_12)
allTrue_5 = List.AllTrue(list=join_5)
code_block_53 = CodeBlock(a=empty, b=flatten_29, x=allTrue_5) { choice=[a,b]; choice[x?1:0]; }
cycle_4 = List.Cycle(list=getItemAtIndex_31, amount=count_6)
chop_4 = List.Chop(list=cycle_4, lengths=count_7)
getItemAtIndex_54 = List.GetItemAtIndex(list=chop_4@L2, index=allIndicesOf_13@L2)
removeItemAtIndex_11 = List.RemoveItemAtIndex(list=getItemAtIndex_54@L2, indices=indexOf_6@L1)
cycle_5 = List.Cycle(list=getItemAtIndex_18, amount=count_3)
chop_5 = List.Chop(list=cycle_5, lengths=count_4)
getItemAtIndex_55 = List.GetItemAtIndex(list=chop_5@L2, index=allIndicesOf_7@L2)
removeItemAtIndex_12 = List.RemoveItemAtIndex(list=getItemAtIndex_55@L2, indices=indexOf_4@L1)
list_create_10 = List.Create(item0=removeItemAtIndex_12)
list_create_11 = List.Create(item0=removeItemAtIndex_11, item1=list_create_10)
list_create_12 = List.Create(item0=list_create_11, item1=getItemAtIndex_36)
flatten_30 = List.Flatten(list=list_create_12)
eq_13 = boolean_2 == getItemAtIndex_50
eq_14 = boolean_2 == getItemAtIndex_51
eq_15 = boolean == getItemAtIndex_52
eq_16 = boolean == getItemAtIndex_53
join_6 = List.Join(list0=eq_13, list1=eq_14, list2=eq_15, list3=eq_16)
allTrue_6 = List.AllTrue(list=join_6)
code_block_54 = CodeBlock(a=empty, b=flatten_30, x=allTrue_6) { choice=[a,b]; choice[x?1:0]; }
cycle_6 = List.Cycle(list=getItemAtIndex_44, amount=count_9)
chop_6 = List.Chop(list=cycle_6, lengths=count_10)
getItemAtIndex_56 = List.GetItemAtIndex(list=chop_6@L2, index=allIndicesOf_19@L2)
removeItemAtIndex_13 = List.RemoveItemAtIndex(list=getItemAtIndex_56@L2, indices=indexOf_8@L1)
list_create_13 = List.Create(item0=removeItemAtIndex_13, item1=list_create_11)
list_create_14 = List.Create(item0=getItemAtIndex_49, item1=list_create_13)
flatten_31 = List.Flatten(list=list_create_14)
eq_17 = boolean_2 == getItemAtIndex_50
eq_18 = boolean_2 == getItemAtIndex_51
eq_19 = boolean_2 == getItemAtIndex_52
eq_20 = boolean == getItemAtIndex_53
join_7 = List.Join(list0=eq_17, list1=eq_18, list2=eq_19, list3=eq_20)
allTrue_7 = List.AllTrue(list=join_7)
code_block_55 = CodeBlock(a=empty, b=flatten_31, x=allTrue_7) { choice=[a,b]; choice[x?1:0]; }
flatten_32 = List.Flatten(list=filterByBoolMask_5.in@L1)
flatten_33 = List.Flatten(list=count_11@L1)
getItemAtIndex_57 = List.GetItemAtIndex(list=pruneDuplicates_7, index=map_12)
list_create_15 = List.Create(item0=flatten_32, item1=flatten_33, item2=getItemAtIndex_57)
transpose_5 = List.Transpose(lists=list_create_15)
code_block_56 = CodeBlock { 1; }
ge_4 = count_11 >= code_block_56
code_block_57 = CodeBlock { true; }
allIndicesOf_22 = List.AllIndicesOf(list=ge_4, item=code_block_57)
getItemAtIndex_58 = List.GetItemAtIndex(list=transpose_5, index=allIndicesOf_22)
code_block_58 = CodeBlock { 0; 2; }
getItemAtIndex_59 = List.GetItemAtIndex(list=getItemAtIndex_58@L3, index=code_block_58.out0)
startPoint_6 = Curve.StartPoint(curve=getItemAtIndex_59)
getItemAtIndex_60 = List.GetItemAtIndex(list=getItemAtIndex_58@L3, index=code_block_58.out1)
flatten_34 = List.Flatten(list=startPoint_6)
distanceTo_4 = Geometry.DistanceTo(geometry=getItemAtIndex_60, other=flatten_34, lacing=Shortest)
sort_8 = List.Sort(list=distanceTo_4@L2)
code_block_59 = CodeBlock { 0; }
getItemAtIndex_61 = List.GetItemAtIndex(list=sort_8@L2, index=code_block_59)
indexOf_9 = List.IndexOf(list=distanceTo_4@L2, element=getItemAtIndex_61, lacing=Shortest)
getItemAtIndex_62 = List.GetItemAtIndex(list=getItemAtIndex_60@L2, index=indexOf_9@L1)
byStartPointEndPoint_7 = Line.ByStartPointEndPoint(startPoint=startPoint_6, endPoint=getItemAtIndex_62)
flatten_35 = List.Flatten(list=byStartPointEndPoint_7)
endPoint_5 = Curve.EndPoint(curve=flatten_35)
doesIntersect_13 = Geometry.DoesIntersect(geometry=endPoint_5, other=flatten_35, lacing=CrossProduct)
countTrue_4 = List.CountTrue(list=doesIntersect_13@L2)
code_block_60 = CodeBlock { 2; }
allIndicesOf_23 = List.AllIndicesOf(list=countTrue_4, item=code_block_60)
getItemAtIndex_63 = List.GetItemAtIndex(list=flatten_35, index=allIndicesOf_23)
intersect_10 = Geometry.Intersect(other=getItemAtIndex_63)  # unwired: geometry
map_13 = List.Map(list=getItemAtIndex_63, function=intersect_10)
flatten_36 = List.Flatten(list=map_13)
string_from_object_8 = FromObject(object=flatten_36)
code_block_61 = CodeBlock { "Line"; }
contains_8 = String.Contains(string=string_from_object_8, searchFor=code_block_61)
code_block_62 = CodeBlock { false; }
allIndicesOf_24 = List.AllIndicesOf(list=contains_8, item=code_block_62)
getItemAtIndex_64 = List.GetItemAtIndex(list=flatten_36, index=allIndicesOf_24)
pruneDuplicates_8 = Point.PruneDuplicates(points=getItemAtIndex_64)
count_12 = List.Count(list=pruneDuplicates_8)
cycle_7 = List.Cycle(list=getItemAtIndex_63, amount=count_12)
count_13 = List.Count(list=getItemAtIndex_63)
chop_7 = List.Chop(list=cycle_7, lengths=count_13)
doesIntersect_14 = Geometry.DoesIntersect(geometry=pruneDuplicates_8, other=getItemAtIndex_63, lacing=CrossProduct)
code_block_63 = CodeBlock { true; }
allIndicesOf_25 = List.AllIndicesOf(list=doesIntersect_14@L2, item=code_block_63)
getItemAtIndex_65 = List.GetItemAtIndex(list=chop_7@L2, index=allIndicesOf_25@L2)
flatten_37 = List.Flatten(list=getItemAtIndex_59)
getItemAtIndex_66 = List.GetItemAtIndex(list=flatten_37, index=allIndicesOf_23)
cycle_8 = List.Cycle(list=getItemAtIndex_66, amount=count_12)
chop_8 = List.Chop(list=cycle_8, lengths=count_13)
getItemAtIndex_67 = List.GetItemAtIndex(list=chop_8@L2, index=allIndicesOf_25@L2)
length_5 = Curve.Length(curve=getItemAtIndex_67@L2)
sort_9 = List.Sort(list=length_5@L2)
firstItem_4 = List.FirstItem(list=sort_9@L2)
indexOf_10 = List.IndexOf(list=length_5@L2, element=firstItem_4@L1, lacing=Shortest)
removeItemAtIndex_14 = List.RemoveItemAtIndex(list=getItemAtIndex_65@L2, indices=indexOf_10@L1)
list_create_16 = List.Create(item0=removeItemAtIndex_14, item1=list_create_13)
removeItemAtIndex_15 = List.RemoveItemAtIndex(list=flatten_37, indices=allIndicesOf_23)
getItemAtIndex_68 = List.GetItemAtIndex(list=getItemAtIndex_67@L2, index=indexOf_10@L1)
removeItemAtIndex_16 = List.RemoveItemAtIndex(list=transpose_5, indices=allIndicesOf_22)
code_block_64 = CodeBlock { 0; }
getItemAtIndex_69 = List.GetItemAtIndex(list=removeItemAtIndex_16@L3, index=code_block_64)
list_create_17 = List.Create(item0=removeItemAtIndex_15, item1=getItemAtIndex_68, item2=getItemAtIndex_69)
flatten_38 = List.Flatten(list=list_create_17)
isNull_5 = Object.IsNull(object=flatten_38)
code_block_65 = CodeBlock { false; }
allIndicesOf_26 = List.AllIndicesOf(list=isNull_5, item=code_block_65)
getItemAtIndex_70 = List.GetItemAtIndex(list=flatten_38, index=allIndicesOf_26)
list_create_18 = List.Create(item0=list_create_16, item1=getItemAtIndex_70)
flatten_39 = List.Flatten(list=list_create_18)
eq_21 = boolean_2 == getItemAtIndex_50
eq_22 = boolean_2 == getItemAtIndex_51
eq_23 = boolean_2 == getItemAtIndex_52
eq_24 = boolean_2 == getItemAtIndex_53
join_8 = List.Join(list0=eq_21, list1=eq_22, list2=eq_23, list3=eq_24)
allTrue_8 = List.AllTrue(list=join_8)
code_block_66 = CodeBlock(a=empty, b=flatten_39, x=allTrue_8) { choice=[a,b]; choice[x?1:0]; }
list_create_19 = List.Create(item0=code_block_52.out1, item1=code_block_53.out1, item2=code_block_54.out1, item3=code_block_55.out1, item4=code_block_66.out1)
flatten_40 = List.Flatten(list=list_create_19)
isNull_6 = Object.IsNull(object=flatten_40)
code_block_67 = CodeBlock { false; }
allIndicesOf_27 = List.AllIndicesOf(list=isNull_6, item=code_block_67)
getItemAtIndex_71 = List.GetItemAtIndex(list=flatten_40, index=allIndicesOf_27)

code_block_68 = CodeBlock(curves=getItemAtIndex_71) { curves; }
subwegen_Breedte = IntegerSlider(9000, range=3500..9000 step 100)
code_block_69 = CodeBlock(mainroad=getItemAtIndex_6) { mainroad; }
hoofdweg_Breedte = IntegerSlider(9000, range=3500..9000 step 100)

# group: OffsetWegen
code_block_70 = CodeBlock(x=subwegen_Breedte) { x/2; }
offset = Curve.Offset(curve=code_block_68, distance=code_block_70)
code_block_71 = CodeBlock { 0.5; }
pointAtParameter = Curve.PointAtParameter(curve=offset, param=code_block_71)
startPoint_7 = Curve.StartPoint(curve=code_block_68)
endPoint_6 = Curve.EndPoint(curve=code_block_68)
byTwoPoints_2 = Vector.ByTwoPoints(start=startPoint_7, end=endPoint_6)
reverse = Vector.Reverse(vector=byTwoPoints_2)
project_2 = Point.Project(point=pointAtParameter, baseGeometry=byJoinedCurves, projectionDirection=reverse)
endPoint_7 = Curve.EndPoint(curve=offset)
byStartPointEndPoint_8 = Line.ByStartPointEndPoint(startPoint=project_2, endPoint=endPoint_7)
code_block_72 = CodeBlock(x=code_block_70) { -x; }
offset_2 = Curve.Offset(curve=code_block_68, distance=code_block_72)
code_block_73 = CodeBlock { 0.5; }
pointAtParameter_2 = Curve.PointAtParameter(curve=offset_2, param=code_block_73)
project_3 = Point.Project(point=pointAtParameter_2, baseGeometry=byJoinedCurves, projectionDirection=reverse)
endPoint_8 = Curve.EndPoint(curve=offset_2)
byStartPointEndPoint_9 = Line.ByStartPointEndPoint(startPoint=project_3, endPoint=endPoint_8)
list_create_20 = List.Create(item0=byStartPointEndPoint_8, item1=byStartPointEndPoint_9)
transpose_6 = List.Transpose(lists=list_create_20)
flatten_41 = List.Flatten(list=transpose_6@L3)
code_block_74 = CodeBlock(x=hoofdweg_Breedte) { x/2; }
offset_3 = Curve.Offset(curve=code_block_69, distance=code_block_74)
code_block_75 = CodeBlock { 0.5; }
pointAtParameter_3 = Curve.PointAtParameter(curve=offset_3, param=code_block_75)
startPoint_8 = Curve.StartPoint(curve=code_block_69)
endPoint_9 = Curve.EndPoint(curve=code_block_69)
byTwoPoints_3 = Vector.ByTwoPoints(start=startPoint_8, end=endPoint_9)
project_4 = Point.Project(point=pointAtParameter_3, baseGeometry=byJoinedCurves, projectionDirection=byTwoPoints_3)
reverse_2 = Vector.Reverse(vector=byTwoPoints_3)
project_5 = Point.Project(point=pointAtParameter_3, baseGeometry=byJoinedCurves, projectionDirection=reverse_2)
byStartPointEndPoint_10 = Line.ByStartPointEndPoint(startPoint=project_4, endPoint=project_5)
startPoint_9 = Curve.StartPoint(curve=byStartPointEndPoint_10)
endPoint_10 = Curve.EndPoint(curve=byStartPointEndPoint_10)
code_block_76 = CodeBlock(x=code_block_74) { -x; }
offset_4 = Curve.Offset(curve=code_block_69, distance=code_block_76)
code_block_77 = CodeBlock { 0.5; }
pointAtParameter_4 = Curve.PointAtParameter(curve=offset_4, param=code_block_77)
project_6 = Point.Project(point=pointAtParameter_4, baseGeometry=byJoinedCurves, projectionDirection=byTwoPoints_3)
project_7 = Point.Project(point=pointAtParameter_4, baseGeometry=byJoinedCurves, projectionDirection=reverse_2)
byStartPointEndPoint_11 = Line.ByStartPointEndPoint(startPoint=project_6, endPoint=project_7)
endPoint_11 = Curve.EndPoint(curve=byStartPointEndPoint_11)
startPoint_10 = Curve.StartPoint(curve=byStartPointEndPoint_11)
join_9 = List.Join(list0=startPoint_9, list1=endPoint_10, list2=endPoint_11, list3=startPoint_10)
byPoints_2 = Polygon.ByPoints(points=join_9)
byPatch_2 = Surface.ByPatch(closedCurve=byPoints_2)
doesIntersect_15 = Geometry.DoesIntersect(geometry=flatten_41@L2, other=byPatch_2, lacing=CrossProduct)
allTrue_9 = List.AllTrue(list=doesIntersect_15@L2)
code_block_78 = CodeBlock { true; }
allIndicesOf_28 = List.AllIndicesOf(list=allTrue_9, item=code_block_78)
removeItemAtIndex_17 = List.RemoveItemAtIndex(list=flatten_41, indices=allIndicesOf_28)
doesIntersect_16 = Geometry.DoesIntersect(geometry=removeItemAtIndex_17@L2, other=byPatch_2, lacing=CrossProduct)
code_block_79 = CodeBlock { true; }
contains_9 = List.Contains(list=doesIntersect_16@L2, item=code_block_79)
code_block_80 = CodeBlock { true; }
allIndicesOf_29 = List.AllIndicesOf(list=contains_9, item=code_block_80)
getItemAtIndex_72 = List.GetItemAtIndex(list=removeItemAtIndex_17, index=allIndicesOf_29)
flatten_42 = List.Flatten(list=getItemAtIndex_72)
code_block_81 = CodeBlock { 100000; }
extendEnd_2 = Curve.ExtendEnd(curve=flatten_42, distance=code_block_81)
doesIntersect_17 = Geometry.DoesIntersect(geometry=extendEnd_2, other=byPatch_2, lacing=CrossProduct)
code_block_82 = CodeBlock { true; }
allIndicesOf_30 = List.AllIndicesOf(list=doesIntersect_17, item=code_block_82)
getItemAtIndex_73 = List.GetItemAtIndex(list=flatten_42, index=allIndicesOf_30)
startPoint_11 = Curve.StartPoint(curve=getItemAtIndex_73)
endPoint_12 = Curve.EndPoint(curve=getItemAtIndex_73)
byTwoPoints_4 = Vector.ByTwoPoints(start=startPoint_11, end=endPoint_12)
project_8 = Point.Project(point=startPoint_11, baseGeometry=byStartPointEndPoint_10, projectionDirection=byTwoPoints_4, lacing=Longest)
project_9 = Point.Project(point=startPoint_11, baseGeometry=byStartPointEndPoint_11, projectionDirection=byTwoPoints_4, lacing=Longest)
list_create_21 = List.Create(item0=project_8, item1=project_9)
transpose_7 = List.Transpose(lists=list_create_21)
flatten_43 = List.Flatten(list=transpose_7@L3)
distanceTo_5 = Geometry.DistanceTo(geometry=startPoint_11, other=flatten_43)
sort_10 = List.Sort(list=distanceTo_5@L2)
firstItem_5 = List.FirstItem(list=sort_10@L2)
indexOf_11 = List.IndexOf(list=distanceTo_5@L2, element=firstItem_5@L1)
getItemAtIndex_74 = List.GetItemAtIndex(list=flatten_43@L2, index=indexOf_11@L1)
byStartPointEndPoint_12 = Line.ByStartPointEndPoint(startPoint=startPoint_11, endPoint=getItemAtIndex_74)
code_block_83 = CodeBlock { false; }
allIndicesOf_31 = List.AllIndicesOf(list=doesIntersect_17, item=code_block_83)
getItemAtIndex_75 = List.GetItemAtIndex(list=flatten_42, index=allIndicesOf_31)
startPoint_12 = Curve.StartPoint(curve=getItemAtIndex_75)
endPoint_13 = Curve.EndPoint(curve=getItemAtIndex_75)
byTwoPoints_5 = Vector.ByTwoPoints(start=startPoint_12, end=endPoint_13)
code_block_84 = CodeBlock { 100; }
translate_2 = Geometry.Translate(geometry=startPoint_12, direction=byTwoPoints_5, distance=code_block_84)
project_10 = Point.Project(point=translate_2, baseGeometry=byJoinedCurves, projectionDirection=byTwoPoints_5, lacing=Longest)
flatten_44 = List.Flatten(list=project_10)
byStartPointEndPoint_13 = Line.ByStartPointEndPoint(startPoint=startPoint_12, endPoint=flatten_44)
getItemAtIndex_76 = List.GetItemAtIndex(list=flatten_41, index=allIndicesOf_28)
flatten_45 = List.Flatten(list=getItemAtIndex_76)
startPoint_13 = Curve.StartPoint(curve=flatten_45)
endPoint_14 = Curve.EndPoint(curve=flatten_45)
byTwoPoints_6 = Vector.ByTwoPoints(start=startPoint_13, end=endPoint_14)
project_11 = Point.Project(point=startPoint_13, baseGeometry=byStartPointEndPoint_10, projectionDirection=byTwoPoints_6, lacing=Longest)
project_12 = Point.Project(point=startPoint_13, baseGeometry=byStartPointEndPoint_11, projectionDirection=byTwoPoints_6, lacing=Longest)
list_create_22 = List.Create(item0=project_11, item1=project_12)
transpose_8 = List.Transpose(lists=list_create_22)
flatten_46 = List.Flatten(list=transpose_8@L3)
distanceTo_6 = Geometry.DistanceTo(geometry=startPoint_13, other=flatten_46)
sort_11 = List.Sort(list=distanceTo_6@L2)
firstItem_6 = List.FirstItem(list=sort_11@L2)
indexOf_12 = List.IndexOf(list=distanceTo_6@L2, element=firstItem_6@L1)
getItemAtIndex_77 = List.GetItemAtIndex(list=flatten_46@L2, index=indexOf_12@L1)
byStartPointEndPoint_14 = Line.ByStartPointEndPoint(startPoint=startPoint_13, endPoint=getItemAtIndex_77)
removeItemAtIndex_18 = List.RemoveItemAtIndex(list=removeItemAtIndex_17, indices=allIndicesOf_29)
flatten_47 = List.Flatten(list=removeItemAtIndex_18)
startPoint_14 = Curve.StartPoint(curve=flatten_47)
startPoint_15 = Curve.StartPoint(curve=flatten_47)
endPoint_15 = Curve.EndPoint(curve=flatten_47)
byTwoPoints_7 = Vector.ByTwoPoints(start=startPoint_15, end=endPoint_15)
code_block_85 = CodeBlock { 100; }
translate_3 = Geometry.Translate(geometry=startPoint_15, direction=byTwoPoints_7, distance=code_block_85)
list_create_23 = List.Create(item0=getItemAtIndex_72, item1=flatten_45, item2=byJoinedCurves)
flatten_48 = List.Flatten(list=list_create_23)
isNull_7 = Object.IsNull(object=flatten_48)
code_block_86 = CodeBlock { false; }
allIndicesOf_32 = List.AllIndicesOf(list=isNull_7, item=code_block_86)
getItemAtIndex_78 = List.GetItemAtIndex(list=flatten_48, index=allIndicesOf_32)
project_13 = Point.Project(point=translate_3, baseGeometry=getItemAtIndex_78, projectionDirection=byTwoPoints_7, lacing=CrossProduct)
flatten_49 = List.Flatten(list=project_13)
pruneDuplicates_9 = Point.PruneDuplicates(points=flatten_49)
length_6 = Curve.Length(curve=byStartPointEndPoint_11)
extendEnd_3 = Curve.ExtendEnd(curve=flatten_47, distance=length_6, lacing=Longest)
doesIntersect_18 = Geometry.DoesIntersect(geometry=extendEnd_3, other=pruneDuplicates_9, lacing=CrossProduct)
code_block_87 = CodeBlock { true; }
allIndicesOf_33 = List.AllIndicesOf(list=doesIntersect_18@L2, item=code_block_87)
getItemAtIndex_79 = List.GetItemAtIndex(list=pruneDuplicates_9, index=allIndicesOf_33)
distanceTo_7 = Geometry.DistanceTo(geometry=startPoint_14, other=getItemAtIndex_79)
sort_12 = List.Sort(list=distanceTo_7@L2)
firstItem_7 = List.FirstItem(list=sort_12@L2)
indexOf_13 = List.IndexOf(list=distanceTo_7@L2, element=firstItem_7@L1)
getItemAtIndex_80 = List.GetItemAtIndex(list=getItemAtIndex_79, index=indexOf_13, lacing=Shortest)
byStartPointEndPoint_15 = Line.ByStartPointEndPoint(startPoint=startPoint_14, endPoint=getItemAtIndex_80)
list_create_24 = List.Create(item0=byStartPointEndPoint_12, item1=byStartPointEndPoint_13, item2=byStartPointEndPoint_14, item3=byStartPointEndPoint_15, item4=byStartPointEndPoint_10, item5=byStartPointEndPoint_11)
flatten_50 = List.Flatten(list=list_create_24)
code_block_88 = CodeBlock { 2; }
chop_9 = List.Chop(list=flatten_50, lengths=code_block_88)
code_block_89 = CodeBlock { 0; 1; }
getItemAtIndex_81 = List.GetItemAtIndex(list=chop_9@L2, index=code_block_89.out0)
getItemAtIndex_82 = List.GetItemAtIndex(list=chop_9@L2, index=code_block_89.out1)
reverse_3 = Curve.Reverse(curve=getItemAtIndex_82)
list_create_25 = List.Create(item0=getItemAtIndex_81, item1=reverse_3)
transpose_9 = List.Transpose(lists=list_create_25)
endPoint_16 = Curve.EndPoint(curve=transpose_9)
code_block_90 = CodeBlock { 0; 1; }
getItemAtIndex_83 = List.GetItemAtIndex(list=endPoint_16@L2, index=code_block_90.out0)
startPoint_16 = Curve.StartPoint(curve=transpose_9)
getItemAtIndex_84 = List.GetItemAtIndex(list=startPoint_16@L2, index=code_block_90.out1)
getItemAtIndex_85 = List.GetItemAtIndex(list=endPoint_16@L2, index=code_block_90.out1)
getItemAtIndex_86 = List.GetItemAtIndex(list=startPoint_16@L2, index=code_block_90.out0)
list_create_26 = List.Create(item0=getItemAtIndex_83, item1=getItemAtIndex_84, item2=getItemAtIndex_85, item3=getItemAtIndex_86)
transpose_10 = List.Transpose(lists=list_create_26)
byPoints_3 = Polygon.ByPoints(points=transpose_10)
byPatch_3 = Surface.ByPatch(closedCurve=byPoints_3)
byUnion = Surface.ByUnion(surfaces=byPatch_3)
difference = Surface.Difference(surface=byPatch, others=byUnion)
explode = Geometry.Explode(geometry=difference)

code_block_91 = CodeBlock(kavels=explode, wegen=byUnion) { kavels; wegen; }
integer_slider = IntegerSlider(20000, range=1000..30000 step 1000)
cellDepth = IntegerSlider(30000, range=0..30000 step 1)  # graph input
cellWidth = IntegerSlider(16000, range=0..16000 step 1)  # graph input

# group: ScherpeHoeken
code_block_92 = CodeBlock(Kavelsurfaces=code_block_91.kavels) { Kavelsurfaces: var[]..[]; }
# note: Paart alle hoeken bij elkaar in setjes van twee lijnen
perimeterCurves_2 = Surface.PerimeterCurves(surface=code_block_92)
byJoinedCurves_2 = PolyCurve.ByJoinedCurves(curves=perimeterCurves_2)
flatten_51 = List.Flatten(list=perimeterCurves_2)
startPoint_17 = Curve.StartPoint(curve=perimeterCurves_2)
flatten_52 = List.Flatten(list=startPoint_17)
doesIntersect_19 = Geometry.DoesIntersect(geometry=flatten_52, other=flatten_51, lacing=CrossProduct)
code_block_93 = CodeBlock { true; }
allIndicesOf_34 = List.AllIndicesOf(list=doesIntersect_19@L2, item=code_block_93)
getItemAtIndex_87 = List.GetItemAtIndex(list=flatten_51, index=allIndicesOf_34)
firstItem_8 = List.FirstItem(list=getItemAtIndex_87@L2)
lastItem_2 = List.LastItem(list=getItemAtIndex_87@L2)
intersect_11 = Geometry.Intersect(geometry=firstItem_8, other=lastItem_2)
endPoint_17 = Curve.EndPoint(curve=getItemAtIndex_87)
startPoint_18 = Curve.StartPoint(curve=getItemAtIndex_87)
list_create_27 = List.Create(item0=endPoint_17, item1=startPoint_18)
transpose_11 = List.Transpose(lists=list_create_27)
flatten_53 = List.Flatten(list=transpose_11@L3)
code_block_94 = CodeBlock { 0.001; }
code_block_95 = CodeBlock(po=flatten_53, pr=code_block_94) { a = [po.X,po.Y,po.Z]; ar = Math.Round(a/pr)*pr; ar[0]; ar[1]; ar[2]; }
byCoordinates = Point.ByCoordinates(x=code_block_95.out2, y=code_block_95.out3, z=code_block_95.out4)
uniqueItems = List.UniqueItems(list=byCoordinates@L2)
allIndicesOf_35 = List.AllIndicesOf(list=byCoordinates, item=uniqueItems, lacing=Shortest)
flatten_54 = List.Flatten(list=allIndicesOf_35@L3)
count_14 = List.Count(list=allIndicesOf_35@L2)
count_15 = List.Count(list=uniqueItems@L2)
chop_10 = List.Chop(list=count_14, lengths=count_15)
code_block_96 = CodeBlock { 2; }
eq_25 = chop_10 == code_block_96
code_block_97 = CodeBlock { true; }
allIndicesOf_36 = List.AllIndicesOf(list=eq_25@L2, item=code_block_97)
flatten_55 = List.Flatten(list=allIndicesOf_36)
getItemAtIndex_88 = List.GetItemAtIndex(list=allIndicesOf_35, index=flatten_55, lacing=Shortest)
removeItemAtIndex_19 = List.RemoveItemAtIndex(list=flatten_54@L2, indices=getItemAtIndex_88)
firstItem_9 = List.FirstItem(list=removeItemAtIndex_19)
getItemAtIndex_89 = List.GetItemAtIndex(list=flatten_53@L2, index=firstItem_9, lacing=Shortest)
list_create_28 = List.Create(item0=intersect_11, item1=getItemAtIndex_89)
transpose_12 = List.Transpose(lists=list_create_28)
flatten_56 = List.Flatten(list=transpose_12@L3)
code_block_98 = CodeBlock { 0; 1; 2; }
getItemAtIndex_90 = List.GetItemAtIndex(list=flatten_56@L2, index=code_block_98.out0)
getItemAtIndex_91 = List.GetItemAtIndex(list=flatten_56@L2, index=code_block_98.out1)
byStartPointEndPoint_16 = Line.ByStartPointEndPoint(startPoint=getItemAtIndex_90, endPoint=getItemAtIndex_91)
getItemAtIndex_92 = List.GetItemAtIndex(list=flatten_56@L2, index=code_block_98.out2)
byStartPointEndPoint_17 = Line.ByStartPointEndPoint(startPoint=getItemAtIndex_90, endPoint=getItemAtIndex_92)
list_create_29 = List.Create(item0=byStartPointEndPoint_16, item1=byStartPointEndPoint_17)
transpose_13 = List.Transpose(lists=list_create_29)
# note: Achterhaalt de hoeken in graden. Filtert de hoeken kleiner dan threshold ui de lijst
startPoint_19 = Curve.StartPoint(curve=byStartPointEndPoint_16)
endPoint_18 = Curve.EndPoint(curve=byStartPointEndPoint_16)
byTwoPoints_8 = Vector.ByTwoPoints(start=startPoint_19, end=endPoint_18)
startPoint_20 = Curve.StartPoint(curve=byStartPointEndPoint_17)
endPoint_19 = Curve.EndPoint(curve=byStartPointEndPoint_17)
byTwoPoints_9 = Vector.ByTwoPoints(start=startPoint_20, end=endPoint_19)
angleWithVector = Vector.AngleWithVector(vector=byTwoPoints_8, otherVector=byTwoPoints_9)
integer_slider_2 = IntegerSlider(89, range=0..180 step 1)
le = angleWithVector <= integer_slider_2
code_block_99 = CodeBlock { true; }
allIndicesOf_37 = List.AllIndicesOf(list=le, item=code_block_99)
getItemAtIndex_93 = List.GetItemAtIndex(list=transpose_13, index=allIndicesOf_37)
code_block_100 = CodeBlock { 0; 1; }
getItemAtIndex_94 = List.GetItemAtIndex(list=getItemAtIndex_93@L2, index=code_block_100.out1)
# note: •  trekt een lijn tussen de twee zijden van de hoek
# •  kijkt of dit de korte zijde of de lange zijde van de driekhoek is
startPoint_21 = Curve.StartPoint(curve=getItemAtIndex_93)
code_block_101 = CodeBlock { 0; 1; }
getItemAtIndex_95 = List.GetItemAtIndex(list=startPoint_21@L2, index=code_block_101.out0)
getItemAtIndex_96 = List.GetItemAtIndex(list=getItemAtIndex_93@L2, index=code_block_101.out1)
getItemAtIndex_97 = List.GetItemAtIndex(list=getItemAtIndex_93@L2, index=code_block_101.out0)
integer_slider_3 = IntegerSlider(25100, range=100..50000 step 1000)
pointAtSegmentLength = Curve.PointAtSegmentLength(curve=getItemAtIndex_97, segmentLength=integer_slider_3)
closestPointTo = Geometry.ClosestPointTo(geometry=getItemAtIndex_96, other=pointAtSegmentLength)
byStartPointEndPoint_18 = Line.ByStartPointEndPoint(startPoint=getItemAtIndex_95, endPoint=closestPointTo)
length_7 = Curve.Length(curve=byStartPointEndPoint_18)
byStartPointEndPoint_19 = Line.ByStartPointEndPoint(startPoint=closestPointTo, endPoint=pointAtSegmentLength)
length_8 = Curve.Length(curve=byStartPointEndPoint_19)
ge_5 = length_7 >= length_8
code_block_102 = CodeBlock { false; }
allIndicesOf_38 = List.AllIndicesOf(list=ge_5, item=code_block_102)
getItemAtIndex_98 = List.GetItemAtIndex(list=getItemAtIndex_94, index=allIndicesOf_38)
code_block_103 = CodeBlock(seq=getItemAtIndex_98) { seq: var[]..[]; }
getItemAtIndex_99 = List.GetItemAtIndex(list=getItemAtIndex_93@L2, index=code_block_100.out0)
getItemAtIndex_100 = List.GetItemAtIndex(list=getItemAtIndex_99, index=allIndicesOf_38)
length_9 = Curve.Length(curve=getItemAtIndex_98)
length_10 = Curve.Length(curve=getItemAtIndex_100)
gt = length_9 > length_10  # lacing=Shortest
code_block_104 = CodeBlock { false; }
allIndicesOf_39 = List.AllIndicesOf(list=gt, item=code_block_104)
getItemAtIndex_101 = List.GetItemAtIndex(list=getItemAtIndex_100, index=allIndicesOf_39)
code_block_105 = CodeBlock(replacement=getItemAtIndex_101) { replacement: var[]..[]; }
create = List.Create(item0=code_block_105)
flatten_57 = List.Flatten(list=create)
code_block_106 = CodeBlock(indices=allIndicesOf_39) { indices: int[]..[]; }
create_2 = List.Create(item0=code_block_106)
flatten_58 = List.Flatten(list=create_2)
python_script = Python(IN[0]=code_block_103, IN[1]=flatten_57, IN[2]=flatten_58)  # IronPython2
# ---------- python_script.python (9 lines) ----------
_list = IN[0]
rValues = IN[1]
iValues = IN[2]
if len(iValues) > 1 and len(rValues) == 1:
	rValues = [rValues[0]] * len(iValues)
if len(iValues) > 0:
	for (index, value) in zip(iValues, rValues):
		_list[index] = value
OUT = _list
# ----------------------------------------
code_block_107 = CodeBlock(seq=python_script) { seq; }
getItemAtIndex_102 = List.GetItemAtIndex(list=angleWithVector, index=allIndicesOf_37)
code_block_108 = CodeBlock(x=getItemAtIndex_102) { 180-90-x; }
getItemAtIndex_103 = List.GetItemAtIndex(list=code_block_108, index=allIndicesOf_38)
cos = Math.Cos(angle=getItemAtIndex_103)
div = integer_slider / cos
pointAtSegmentLength_2 = Curve.PointAtSegmentLength(curve=code_block_107, segmentLength=div)
code_block_109 = CodeBlock(seq=getItemAtIndex_100) { seq: var[]..[]; }
getItemAtIndex_104 = List.GetItemAtIndex(list=getItemAtIndex_98, index=allIndicesOf_39)
code_block_110 = CodeBlock(replacement=getItemAtIndex_104) { replacement: var[]..[]; }
create_3 = List.Create(item0=code_block_110)
flatten_59 = List.Flatten(list=create_3)
code_block_111 = CodeBlock(indices=allIndicesOf_39) { indices: int[]..[]; }
create_4 = List.Create(item0=code_block_111)
flatten_60 = List.Flatten(list=create_4)
python_script_2 = Python(IN[0]=code_block_109, IN[1]=flatten_59, IN[2]=flatten_60)  # IronPython2; same code as python_script
code_block_112 = CodeBlock(seq=python_script_2) { seq; }
closestPointTo_2 = Geometry.ClosestPointTo(geometry=code_block_112, other=pointAtSegmentLength_2)
byStartPointEndPoint_20 = Line.ByStartPointEndPoint(startPoint=closestPointTo_2, endPoint=pointAtSegmentLength_2)
length_11 = Curve.Length(curve=byStartPointEndPoint_20)
round = Math.Round(number=length_11)
le_2 = round <= integer_slider
code_block_113 = CodeBlock { false; }
allIndicesOf_40 = List.AllIndicesOf(list=le_2, item=code_block_113)
getItemAtIndex_105 = List.GetItemAtIndex(list=pointAtSegmentLength_2, index=allIndicesOf_40)
doesIntersect_20 = Geometry.DoesIntersect(geometry=getItemAtIndex_105, other=byJoinedCurves_2, lacing=CrossProduct)
code_block_114 = CodeBlock { true; }
allIndicesOf_41 = List.AllIndicesOf(list=doesIntersect_20@L2, item=code_block_114)
flatten_61 = List.Flatten(list=allIndicesOf_41)
getItemAtIndex_106 = List.GetItemAtIndex(list=byJoinedCurves_2, index=flatten_61)
explode_2 = Geometry.Explode(geometry=getItemAtIndex_106)
doesIntersect_21 = Geometry.DoesIntersect(geometry=getItemAtIndex_105, other=explode_2)
code_block_115 = CodeBlock { true; }
allIndicesOf_42 = List.AllIndicesOf(list=doesIntersect_21@L2, item=code_block_115)
getItemAtIndex_107 = List.GetItemAtIndex(list=explode_2@L2, index=allIndicesOf_42@L2)
flatten_62 = List.Flatten(list=getItemAtIndex_107)
doesIntersect_22 = Geometry.DoesIntersect(geometry=explode_2, other=flatten_62, lacing=Longest)
code_block_116 = CodeBlock { true; }
allIndicesOf_43 = List.AllIndicesOf(list=doesIntersect_22@L2, item=code_block_116)
removeItemAtIndex_20 = List.RemoveItemAtIndex(list=explode_2@L2, indices=allIndicesOf_43, lacing=Shortest)
flatten_63 = List.Flatten(list=removeItemAtIndex_20@L2)
reverse_4 = Curve.Reverse(curve=flatten_63)
list_create_30 = List.Create(item0=getItemAtIndex_107, item1=reverse_4)
transpose_14 = List.Transpose(lists=list_create_30)
flatten_64 = List.Flatten(list=transpose_14@L3)
code_block_117 = CodeBlock { 0; 1; }
getItemAtIndex_108 = List.GetItemAtIndex(list=flatten_64@L2, index=code_block_117.out1)
code_block_118 = CodeBlock { 100000; }
endPoint_20 = Curve.EndPoint(curve=flatten_64)
extend = Curve.Extend(curve=flatten_64, distance=code_block_118, pickSide=endPoint_20)
startPoint_22 = Curve.StartPoint(curve=flatten_64)
extend_2 = Curve.Extend(curve=extend, distance=code_block_118, pickSide=startPoint_22)
getItemAtIndex_109 = List.GetItemAtIndex(list=extend_2@L2, index=code_block_117.out0)
getItemAtIndex_110 = List.GetItemAtIndex(list=extend_2@L2, index=code_block_117.out1)
intersect_12 = Geometry.Intersect(geometry=getItemAtIndex_109, other=getItemAtIndex_110)
list_create_31 = List.Create(item0=endPoint_20, item1=startPoint_22)
code_block_119 = CodeBlock(KavelBoundary=byJoinedCurves) { KavelBoundary: var[]..[]; }
doesIntersect_23 = Geometry.DoesIntersect(geometry=code_block_119, other=list_create_31)
allTrue_10 = List.AllTrue(list=doesIntersect_23@L2)
code_block_120 = CodeBlock { true; }
allIndicesOf_44 = List.AllIndicesOf(list=allTrue_10, item=code_block_120)
getItemAtIndex_111 = List.GetItemAtIndex(list=list_create_31, index=allIndicesOf_44)
code_block_121 = CodeBlock { 0; }
getItemAtIndex_112 = List.GetItemAtIndex(list=getItemAtIndex_111@L2, index=code_block_121)
byStartPointEndPoint_21 = Line.ByStartPointEndPoint(startPoint=intersect_12, endPoint=getItemAtIndex_112)
startPoint_23 = Curve.StartPoint(curve=getItemAtIndex_109)
endPoint_21 = Curve.EndPoint(curve=getItemAtIndex_109)
byTwoPoints_10 = Vector.ByTwoPoints(start=startPoint_23, end=endPoint_21)
startPoint_24 = Curve.StartPoint(curve=getItemAtIndex_110)
endPoint_22 = Curve.EndPoint(curve=getItemAtIndex_110)
byTwoPoints_11 = Vector.ByTwoPoints(start=startPoint_24, end=endPoint_22)
angleWithVector_2 = Vector.AngleWithVector(vector=byTwoPoints_10, otherVector=byTwoPoints_11)
sin = Math.Sin(angle=angleWithVector_2)
div_2 = integer_slider / sin
pointAtSegmentLength_3 = Curve.PointAtSegmentLength(curve=byStartPointEndPoint_21, segmentLength=div_2)
closestPointTo_3 = Geometry.ClosestPointTo(geometry=getItemAtIndex_108, other=pointAtSegmentLength_3)
byStartPointEndPoint_22 = Line.ByStartPointEndPoint(startPoint=closestPointTo_3, endPoint=pointAtSegmentLength_3)
flatten_65 = List.Flatten(list=byStartPointEndPoint_22)
code_block_122 = CodeBlock { 0; 1; }
getItemAtIndex_113 = List.GetItemAtIndex(list=getItemAtIndex_93@L2, index=code_block_122.out1)
code_block_123 = CodeBlock { true; }
allIndicesOf_45 = List.AllIndicesOf(list=ge_5, item=code_block_123)
getItemAtIndex_114 = List.GetItemAtIndex(list=getItemAtIndex_113, index=allIndicesOf_45)
getItemAtIndex_115 = List.GetItemAtIndex(list=getItemAtIndex_93@L2, index=code_block_122.out0)
getItemAtIndex_116 = List.GetItemAtIndex(list=getItemAtIndex_115, index=allIndicesOf_45)
getItemAtIndex_117 = List.GetItemAtIndex(list=code_block_108, index=allIndicesOf_45)
code_block_124 = CodeBlock(x=getItemAtIndex_117) { 180-90-x; }
sin_2 = Math.Sin(angle=code_block_124)
div_3 = integer_slider / sin_2
pointAtSegmentLength_4 = Curve.PointAtSegmentLength(curve=getItemAtIndex_116, segmentLength=div_3)
closestPointTo_4 = Geometry.ClosestPointTo(geometry=getItemAtIndex_114, other=pointAtSegmentLength_4)
byStartPointEndPoint_23 = Line.ByStartPointEndPoint(startPoint=closestPointTo_4, endPoint=pointAtSegmentLength_4)
list_create_32 = List.Create(item0=flatten_65, item1=byStartPointEndPoint_23)
flatten_66 = List.Flatten(list=list_create_32)
isNull_8 = Object.IsNull(object=flatten_66)
code_block_125 = CodeBlock { true; }
allIndicesOf_46 = List.AllIndicesOf(list=isNull_8, item=code_block_125)
removeItemAtIndex_21 = List.RemoveItemAtIndex(list=flatten_66, indices=allIndicesOf_46)
doesIntersect_24 = Geometry.DoesIntersect(geometry=removeItemAtIndex_21, other=code_block_92, lacing=CrossProduct)
code_block_126 = CodeBlock { true; }
allIndicesOf_47 = List.AllIndicesOf(list=doesIntersect_24@L2, item=code_block_126)
getItemAtIndex_118 = List.GetItemAtIndex(list=code_block_92, index=allIndicesOf_47)
flatten_67 = List.Flatten(list=removeItemAtIndex_21@L1)
geometrySplit = Geometry.Intersection.GeometrySplit(geometry=getItemAtIndex_118, cutting=flatten_67)
flatten_68 = List.Flatten(list=geometrySplit)
count_16 = List.Count(list=geometrySplit@L2)
code_block_127 = CodeBlock { 1; }
eq_26 = count_16 == code_block_127
filterByBoolMask_6 = List.FilterByBoolMask(list=geometrySplit, mask=eq_26)
flatten_69 = List.Flatten(list=filterByBoolMask_6.out)
list_create_33 = List.Create(item0=getItemAtIndex_98, item1=getItemAtIndex_100)
transpose_15 = List.Transpose(lists=list_create_33)
getItemAtIndex_119 = List.GetItemAtIndex(list=transpose_15, index=allIndicesOf_40)
startPoint_25 = Curve.StartPoint(curve=getItemAtIndex_119)
list_create_34 = List.Create(item0=getItemAtIndex_114, item1=getItemAtIndex_116)
transpose_16 = List.Transpose(lists=list_create_34)
startPoint_26 = Curve.StartPoint(curve=transpose_16)
list_create_35 = List.Create(item0=startPoint_25, item1=startPoint_26)
flatten_70 = List.Flatten(list=list_create_35)
pruneDuplicates_10 = Point.PruneDuplicates(points=flatten_70)
doesIntersect_25 = Geometry.DoesIntersect(geometry=pruneDuplicates_10, other=flatten_69, lacing=CrossProduct)
code_block_128 = CodeBlock { true; }
allIndicesOf_48 = List.AllIndicesOf(list=doesIntersect_25@L2, item=code_block_128)
flatten_71 = List.Flatten(list=allIndicesOf_48)
removeItemAtIndex_22 = List.RemoveItemAtIndex(list=flatten_69, indices=flatten_71)
code_block_129 = CodeBlock(CellDepth=cellDepth) { CellDepth: var[]..[]; }
code_block_130 = CodeBlock(CellWidth=cellWidth) { CellWidth: var[]..[]; }
mul = code_block_129 * code_block_130
area = Surface.Area(surface=removeItemAtIndex_22)
le_3 = mul <= area
code_block_131 = CodeBlock { true; }
allIndicesOf_49 = List.AllIndicesOf(list=le_3, item=code_block_131)
getItemAtIndex_120 = List.GetItemAtIndex(list=removeItemAtIndex_22, index=allIndicesOf_49)
eq_27 = getItemAtIndex_120 == flatten_68  # lacing=CrossProduct
code_block_132 = CodeBlock { true; }
allIndicesOf_50 = List.AllIndicesOf(list=eq_27@L2, item=code_block_132)
flatten_72 = List.Flatten(list=allIndicesOf_50)
removeItemAtIndex_23 = List.RemoveItemAtIndex(list=flatten_68, indices=flatten_72)
code_block_133 = CodeBlock { 78; 129; 0; }
byARGB = Color.ByARGB(red=code_block_133.out0, green=code_block_133.out1, blue=code_block_133.out2)
byGeometryColor = Modifiers.GeometryColor.ByGeometryColor(geometry=removeItemAtIndex_23, color=byARGB)
flatten_73 = List.Flatten(list=allIndicesOf_47)
removeItemAtIndex_24 = List.RemoveItemAtIndex(list=code_block_92, indices=flatten_73)
list_create_36 = List.Create(item0=removeItemAtIndex_24, item1=getItemAtIndex_120)

flatten_74 = List.Flatten(list=list_create_36)
area_2 = Surface.Area(surface=flatten_74)
sum = Math.Sum(values=area_2)
convert_by_units = DynamoUnitConvert(sum, MeasurementType="autodesk.unit.quantity:area-1.0.2", FromConversion="autodesk.unit.unit:squareMillimeters-1.0.1", ToConversion="autodesk.unit.unit:squareMeters-1.0.1")
uitgeefbaarTerrein = Watch(convert_by_units)  # graph output
offsetCell_Y = DoubleSlider(0.5, range=0..1 step 0.1)  # graph input
offsetCell_X = DoubleSlider(0.5, range=0..1 step 0.1)  # graph input

# group: Gridsurfaces
perimeterCurves_3 = Surface.PerimeterCurves(surface=flatten_74)
length_12 = Curve.Length(curve=perimeterCurves_3)
sort_13 = List.Sort(list=length_12)
lastItem_3 = List.LastItem(list=sort_13@L2)
indexOf_14 = List.IndexOf(list=length_12@L2, element=lastItem_3@L1)
getItemAtIndex_121 = List.GetItemAtIndex(list=perimeterCurves_3, index=indexOf_14, lacing=Shortest)
code_block_134 = CodeBlock { 0.5; }
coordinateSystemAtParameter = Curve.CoordinateSystemAtParameter(curve=getItemAtIndex_121, param=code_block_134)
identity = CoordinateSystem.Identity()
transform = Geometry.Transform(geometry=flatten_74, fromCoordinateSystem=coordinateSystemAtParameter, contextCoordinateSystem=identity)
byGeometry = BoundingBox.ByGeometry(geom=transform, lacing=Longest)
code_block_135 = CodeBlock { 0; }
code_block_136 = CodeBlock(bb=byGeometry, z=code_block_135)
# ---------- code_block_136.designscript (7 lines) ----------
a = bb.MinPoint;
b = bb.MaxPoint;
r1 = Rectangle.ByCornerPoints(
  Point.ByCoordinates(a.X, a.Y, z),
  Point.ByCoordinates(b.X, a.Y, z),
  Point.ByCoordinates(b.X, b.Y, z),
  Point.ByCoordinates(a.X, b.Y, z) );
# ----------------------------------------
transform_2 = Geometry.Transform(geometry=code_block_136.r1, fromCoordinateSystem=identity, contextCoordinateSystem=coordinateSystemAtParameter)
explode_3 = Geometry.Explode(geometry=transform_2)
length_13 = Curve.Length(curve=explode_3)
sort_14 = List.Sort(list=length_13)
lastItem_4 = List.LastItem(list=sort_14@L2)
allIndicesOf_51 = List.AllIndicesOf(list=length_13@L2, item=lastItem_4, lacing=Longest)
getItemAtIndex_122 = List.GetItemAtIndex(list=explode_3@L2, index=allIndicesOf_51@L2)
code_block_137 = CodeBlock { 0; 1; }
getItemAtIndex_123 = List.GetItemAtIndex(list=getItemAtIndex_122@L2, index=code_block_137.out0)
startPoint_27 = Curve.StartPoint(curve=getItemAtIndex_123)
endPoint_23 = Curve.EndPoint(curve=getItemAtIndex_123)
byStartPointEndPoint_24 = Line.ByStartPointEndPoint(startPoint=startPoint_27, endPoint=endPoint_23)
getItemAtIndex_124 = List.GetItemAtIndex(list=getItemAtIndex_122@L2, index=code_block_137.out1)
endPoint_24 = Curve.EndPoint(curve=getItemAtIndex_124)
startPoint_28 = Curve.StartPoint(curve=getItemAtIndex_124)
byStartPointEndPoint_25 = Line.ByStartPointEndPoint(startPoint=endPoint_24, endPoint=startPoint_28)
list_create_37 = List.Create(item0=byStartPointEndPoint_24, item1=byStartPointEndPoint_25)
transpose_17 = List.Transpose(lists=list_create_37)
pointAtParameter_5 = Curve.PointAtParameter(curve=transpose_17, param=offsetCell_Y)
pointsAtSegmentLengthFromPoint = Curve.PointsAtSegmentLengthFromPoint(curve=transpose_17, point=pointAtParameter_5, segmentLength=cellDepth)
code_block_138 = CodeBlock { 0; 1; }
getItemAtIndex_125 = List.GetItemAtIndex(list=pointsAtSegmentLengthFromPoint@L3, index=code_block_138.out0)
getItemAtIndex_126 = List.GetItemAtIndex(list=pointsAtSegmentLengthFromPoint@L3, index=code_block_138.out1)
byStartPointEndPoint_26 = Line.ByStartPointEndPoint(startPoint=getItemAtIndex_125, endPoint=getItemAtIndex_126)
firstItem_10 = List.FirstItem(list=sort_14@L2)
allIndicesOf_52 = List.AllIndicesOf(list=length_13@L2, item=firstItem_10, lacing=Longest)
getItemAtIndex_127 = List.GetItemAtIndex(list=explode_3@L2, index=allIndicesOf_52@L2)
code_block_139 = CodeBlock { 0; 1; }
getItemAtIndex_128 = List.GetItemAtIndex(list=getItemAtIndex_127@L2, index=code_block_139.out0)
startPoint_29 = Curve.StartPoint(curve=getItemAtIndex_128)
endPoint_25 = Curve.EndPoint(curve=getItemAtIndex_128)
byStartPointEndPoint_27 = Line.ByStartPointEndPoint(startPoint=startPoint_29, endPoint=endPoint_25)
getItemAtIndex_129 = List.GetItemAtIndex(list=getItemAtIndex_127@L2, index=code_block_139.out1)
endPoint_26 = Curve.EndPoint(curve=getItemAtIndex_129)
startPoint_30 = Curve.StartPoint(curve=getItemAtIndex_129)
byStartPointEndPoint_28 = Line.ByStartPointEndPoint(startPoint=endPoint_26, endPoint=startPoint_30)
list_create_38 = List.Create(item0=byStartPointEndPoint_27, item1=byStartPointEndPoint_28)
transpose_18 = List.Transpose(lists=list_create_38)
pointAtParameter_6 = Curve.PointAtParameter(curve=transpose_18, param=offsetCell_X)
pointsAtSegmentLengthFromPoint_2 = Curve.PointsAtSegmentLengthFromPoint(curve=transpose_18, point=pointAtParameter_6, segmentLength=cellWidth)
code_block_140 = CodeBlock { 0; 1; }
getItemAtIndex_130 = List.GetItemAtIndex(list=pointsAtSegmentLengthFromPoint_2@L3, index=code_block_140.out0)
getItemAtIndex_131 = List.GetItemAtIndex(list=pointsAtSegmentLengthFromPoint_2@L3, index=code_block_140.out1)
byStartPointEndPoint_29 = Line.ByStartPointEndPoint(startPoint=getItemAtIndex_130, endPoint=getItemAtIndex_131)
list_create_39 = List.Create(item0=byStartPointEndPoint_26, item1=byStartPointEndPoint_29)
transpose_19 = List.Transpose(lists=list_create_39)
flatten_75 = List.Flatten(list=transpose_19@L3)
geometrySplit_2 = Geometry.Intersection.GeometrySplit(geometry=flatten_74, cutting=flatten_75@L2, lacing=Longest)

code_block_141 = CodeBlock(Cells=geometrySplit_2) { Cells; }
perimeterCurves_4 = Surface.PerimeterCurves(surface=code_block_141)
thresholdNumber = DoubleSlider(0.9, range=0..1 step 0.1)  # graph input

# group: CellCleanUP
code_block_142 = CodeBlock(AlleCellen=code_block_141) { AlleCellen: var[]..[]; }
code_block_143 = CodeBlock(AlleCellen=code_block_142) { AlleCellen; }
code_block_144 = CodeBlock(KavelSurfaces=flatten_74) { KavelSurfaces: var[]..[]; }
code_block_145 = CodeBlock(KavelSurfaces=code_block_144) { KavelSurfaces; }
perimeterCurves_5 = Surface.PerimeterCurves(surface=code_block_145)
byJoinedCurves_3 = PolyCurve.ByJoinedCurves(curves=perimeterCurves_5)
doesIntersect_26 = Geometry.DoesIntersect(geometry=byJoinedCurves_3, other=code_block_143, lacing=Longest)
code_block_146 = CodeBlock { true; }
allIndicesOf_53 = List.AllIndicesOf(list=doesIntersect_26@L2, item=code_block_146)
# note: Aangrenzende cellen
getItemAtIndex_132 = List.GetItemAtIndex(list=code_block_143@L2, index=allIndicesOf_53, lacing=Shortest)
perimeterCurves_6 = Surface.PerimeterCurves(surface=getItemAtIndex_132)
length_14 = Curve.Length(curve=perimeterCurves_6)
code_block_147 = CodeBlock(x=length_14) { x/2; }
pointAtSegmentLength_5 = Curve.PointAtSegmentLength(curve=perimeterCurves_6, segmentLength=code_block_147)
doesIntersect_27 = Geometry.DoesIntersect(geometry=pointAtSegmentLength_5, other=byJoinedCurves_3)
code_block_148 = CodeBlock { true; }
allIndicesOf_54 = List.AllIndicesOf(list=doesIntersect_27@L2, item=code_block_148)
# note: Perimetercurves niet clashend met kavelboundary
removeItemAtIndex_25 = List.RemoveItemAtIndex(list=perimeterCurves_6@L2, indices=allIndicesOf_54, lacing=Shortest)
count_17 = List.Count(list=removeItemAtIndex_25@L2)
code_block_149 = CodeBlock { 1; }
eq_28 = count_17 == code_block_149
code_block_150 = CodeBlock { true; }
# note: 1PerimetercurveCells.Indices
allIndicesOf_55 = List.AllIndicesOf(list=eq_28, item=code_block_150)
# note: 1PerimetercurveCells.Curves
getItemAtIndex_133 = List.GetItemAtIndex(list=removeItemAtIndex_25, index=allIndicesOf_55)
flatten_76 = List.Flatten(list=getItemAtIndex_132)
# note: 1PerimetercurveCells.Cells
getItemAtIndex_134 = List.GetItemAtIndex(list=flatten_76, index=allIndicesOf_55)
flatten_77 = List.Flatten(list=code_block_143)
eq_29 = getItemAtIndex_134 == flatten_77  # lacing=CrossProduct
code_block_151 = CodeBlock { true; }
allIndicesOf_56 = List.AllIndicesOf(list=eq_29@L2, item=code_block_151)
flatten_78 = List.Flatten(list=allIndicesOf_56)
# note: OvergeblevenCellen
removeItemAtIndex_26 = List.RemoveItemAtIndex(list=flatten_77, indices=flatten_78)
code_block_152 = CodeBlock(PerimetercurveCells_Curves=getItemAtIndex_133, PerimetercurveCells_Cells=getItemAtIndex_134, PerimetercurveCells_Restant=removeItemAtIndex_26) { PerimetercurveCells_Curves; PerimetercurveCells_Cells; PerimetercurveCells_Restant; }
area_3 = Surface.Area(surface=code_block_152.PerimetercurveCells_Cells)
sort_15 = List.Sort(list=area_3)
code_block_153 = CodeBlock(CellDepth=cellDepth) { CellDepth: var[]..[]; }
code_block_154 = CodeBlock(CellWidth=cellWidth) { CellWidth: var[]..[]; }
mul_2 = code_block_153 * code_block_154
code_block_155 = CodeBlock { 100; }
div_4 = mul_2 / code_block_155
code_block_156 = CodeBlock(ThresholdNumber=thresholdNumber) { ThresholdNumber: var[]..[]; }
mul_3 = code_block_155 * code_block_156
mul_4 = div_4 * mul_3
le_4 = sort_15 <= mul_4
code_block_157 = CodeBlock { true; }
allIndicesOf_57 = List.AllIndicesOf(list=le_4, item=code_block_157)
getItemAtIndex_135 = List.GetItemAtIndex(list=sort_15, index=allIndicesOf_57)
allIndicesOf_58 = List.AllIndicesOf(list=area_3, item=getItemAtIndex_135)
flatten_79 = List.Flatten(list=allIndicesOf_58)
# note: 1PerimetercurveCells.Curves.Filter
getItemAtIndex_136 = List.GetItemAtIndex(list=code_block_152.PerimetercurveCells_Curves, index=flatten_79)
# note: 1PerimetercurveCells.Cells.Filter
getItemAtIndex_137 = List.GetItemAtIndex(list=code_block_152.PerimetercurveCells_Cells, index=flatten_79)
flatten_80 = List.Flatten(list=code_block_143)
eq_30 = getItemAtIndex_137 == flatten_80  # lacing=CrossProduct
code_block_158 = CodeBlock { true; }
allIndicesOf_59 = List.AllIndicesOf(list=eq_30@L2, item=code_block_158)
flatten_81 = List.Flatten(list=allIndicesOf_59)
# note: OvergeblevenCellen.Filter
removeItemAtIndex_27 = List.RemoveItemAtIndex(list=flatten_80, indices=flatten_81)
code_block_159 = CodeBlock(PerimetercurveCells_Curves_Filter=getItemAtIndex_136, PerimetercurveCells_Cells_Filter=getItemAtIndex_137, PerimetercurveCells_Restant_Filter=removeItemAtIndex_27, AlleCellen=code_block_143) { PerimetercurveCells_Curves_Filter; PerimetercurveCells_Cells_Filter; PerimetercurveCells_Restant_Filter; AlleCellen; }
flatten_82 = List.Flatten(list=code_block_159.AlleCellen)
length_15 = Curve.Length(curve=code_block_159.PerimetercurveCells_Curves_Filter)
code_block_160 = CodeBlock(x=length_15) { x/2; }
pointAtSegmentLength_6 = Curve.PointAtSegmentLength(curve=code_block_159.PerimetercurveCells_Curves_Filter, segmentLength=code_block_160)
flatten_83 = List.Flatten(list=pointAtSegmentLength_6)
doesIntersect_28 = Geometry.DoesIntersect(geometry=flatten_83, other=flatten_82, lacing=CrossProduct)
code_block_161 = CodeBlock { true; }
allIndicesOf_60 = List.AllIndicesOf(list=doesIntersect_28@L2, item=code_block_161)
# note: CellenGepaard
getItemAtIndex_138 = List.GetItemAtIndex(list=flatten_82, index=allIndicesOf_60)
flatten_84 = List.Flatten(list=getItemAtIndex_138)
uniqueItems_2 = List.UniqueItems(list=flatten_84)
allIndicesOf_61 = List.AllIndicesOf(list=flatten_84, item=uniqueItems_2)
# note: UniqueIndices
firstItem_11 = List.FirstItem(list=allIndicesOf_61@L2)
flatten_85 = List.Flatten(list=allIndicesOf_60)
# note: Cellen.Overgebleven
removeItemAtIndex_28 = List.RemoveItemAtIndex(list=flatten_82, indices=flatten_85)
count_18 = List.Count(list=allIndicesOf_61@L2)
code_block_162 = CodeBlock { 2; }
ge_6 = count_18 >= code_block_162
code_block_163 = CodeBlock { true; }
allIndicesOf_62 = List.AllIndicesOf(list=ge_6, item=code_block_163)
getItemAtIndex_139 = List.GetItemAtIndex(list=allIndicesOf_61, index=allIndicesOf_62)
# note: DuplicateIndices
lastItem_5 = List.LastItem(list=getItemAtIndex_139@L2)
getItemAtIndex_140 = List.GetItemAtIndex(list=flatten_84, index=lastItem_5)
eq_31 = getItemAtIndex_140 == getItemAtIndex_138  # lacing=CrossProduct
allFalse = List.AllFalse(list=eq_31@L2)
count_19 = List.Count(list=getItemAtIndex_138)
chop_11 = List.Chop(list=allFalse, lengths=count_19)
code_block_164 = CodeBlock { false; }
allIndicesOf_63 = List.AllIndicesOf(list=chop_11@L2, item=code_block_164)
flatten_86 = List.Flatten(list=allIndicesOf_63)
removeItemAtIndex_29 = List.RemoveItemAtIndex(list=getItemAtIndex_138, indices=flatten_86)
byUnion_2 = Surface.ByUnion(surfaces=removeItemAtIndex_29)
getItemAtIndex_141 = List.GetItemAtIndex(list=getItemAtIndex_138, index=flatten_86)
eq_32 = getItemAtIndex_140 == getItemAtIndex_141  # lacing=CrossProduct
allFalse_2 = List.AllFalse(list=eq_32@L2)
count_20 = List.Count(list=eq_32@L3)
chop_12 = List.Chop(list=allFalse_2, lengths=count_20)
code_block_165 = CodeBlock { true; }
allIndicesOf_64 = List.AllIndicesOf(list=chop_12@L2, item=code_block_165)
removeItemAtIndex_30 = List.RemoveItemAtIndex(list=getItemAtIndex_141, indices=allIndicesOf_64)
flatten_87 = List.Flatten(list=removeItemAtIndex_30@L3)
uniqueItems_3 = List.UniqueItems(list=flatten_87@L2)
byUnion_3 = Surface.ByUnion(surfaces=uniqueItems_3)
list_create_40 = List.Create(item0=removeItemAtIndex_28, item1=byUnion_2, item2=byUnion_3)
flatten_88 = List.Flatten(list=list_create_40)
isNull_9 = Object.IsNull(object=flatten_88)
code_block_166 = CodeBlock { true; }
allIndicesOf_65 = List.AllIndicesOf(list=isNull_9, item=code_block_166)
removeItemAtIndex_31 = List.RemoveItemAtIndex(list=flatten_88, indices=allIndicesOf_65)
doesIntersect_29 = Geometry.DoesIntersect(geometry=code_block_145, other=removeItemAtIndex_31, lacing=CrossProduct)
code_block_167 = CodeBlock { true; }
allIndicesOf_66 = List.AllIndicesOf(list=doesIntersect_29@L2, item=code_block_167)
getItemAtIndex_142 = List.GetItemAtIndex(list=removeItemAtIndex_31, index=allIndicesOf_66)
code_block_168 = CodeBlock(AlleCellen=getItemAtIndex_142) { AlleCellen; }
code_block_169 = CodeBlock(KavelSurfaces=code_block_144) { KavelSurfaces; }
perimeterCurves_7 = Surface.PerimeterCurves(surface=code_block_169)
byJoinedCurves_4 = PolyCurve.ByJoinedCurves(curves=perimeterCurves_7)
doesIntersect_30 = Geometry.DoesIntersect(geometry=byJoinedCurves_4, other=code_block_168, lacing=Longest)
code_block_170 = CodeBlock { true; }
allIndicesOf_67 = List.AllIndicesOf(list=doesIntersect_30@L2, item=code_block_170)
getItemAtIndex_143 = List.GetItemAtIndex(list=code_block_168@L2, index=allIndicesOf_67, lacing=Shortest)
perimeterCurves_8 = Surface.PerimeterCurves(surface=getItemAtIndex_143)
length_16 = Curve.Length(curve=perimeterCurves_8)
code_block_171 = CodeBlock(x=length_16) { x/2; }
pointAtSegmentLength_7 = Curve.PointAtSegmentLength(curve=perimeterCurves_8, segmentLength=code_block_171)
doesIntersect_31 = Geometry.DoesIntersect(geometry=pointAtSegmentLength_7, other=byJoinedCurves_4)
code_block_172 = CodeBlock { true; }
allIndicesOf_68 = List.AllIndicesOf(list=doesIntersect_31@L2, item=code_block_172)
removeItemAtIndex_32 = List.RemoveItemAtIndex(list=perimeterCurves_8@L2, indices=allIndicesOf_68, lacing=Shortest)
count_21 = List.Count(list=removeItemAtIndex_32@L2)
code_block_173 = CodeBlock { 3; }
eq_33 = count_21 == code_block_173
code_block_174 = CodeBlock { true; }
# note: 3PerimetercurveCells.Indices
allIndicesOf_69 = List.AllIndicesOf(list=eq_33, item=code_block_174)
# note: 3PerimetercurveCells.Curves
getItemAtIndex_144 = List.GetItemAtIndex(list=removeItemAtIndex_32, index=allIndicesOf_69)
flatten_89 = List.Flatten(list=getItemAtIndex_143)
# note: 3PerimetercurveCells.Cells
getItemAtIndex_145 = List.GetItemAtIndex(list=flatten_89, index=allIndicesOf_69)
flatten_90 = List.Flatten(list=code_block_168)
eq_34 = getItemAtIndex_145 == flatten_90  # lacing=CrossProduct
code_block_175 = CodeBlock { true; }
allIndicesOf_70 = List.AllIndicesOf(list=eq_34@L2, item=code_block_175)
flatten_91 = List.Flatten(list=allIndicesOf_70)
removeItemAtIndex_33 = List.RemoveItemAtIndex(list=flatten_90, indices=flatten_91)
code_block_176 = CodeBlock(PerimetercurveCells_Curves=getItemAtIndex_144, PerimetercurveCells_Cells=getItemAtIndex_145, PerimetercurveCells_Restant=removeItemAtIndex_33) { PerimetercurveCells_Curves; PerimetercurveCells_Cells; PerimetercurveCells_Restant; }
area_4 = Surface.Area(surface=code_block_176.PerimetercurveCells_Cells)
sort_16 = List.Sort(list=area_4)
le_5 = sort_16 <= mul_4
code_block_177 = CodeBlock { true; }
allIndicesOf_71 = List.AllIndicesOf(list=le_5, item=code_block_177)
getItemAtIndex_146 = List.GetItemAtIndex(list=sort_16, index=allIndicesOf_71)
allIndicesOf_72 = List.AllIndicesOf(list=area_4, item=getItemAtIndex_146)
flatten_92 = List.Flatten(list=allIndicesOf_72)
getItemAtIndex_147 = List.GetItemAtIndex(list=code_block_176.PerimetercurveCells_Curves, index=flatten_92)
getItemAtIndex_148 = List.GetItemAtIndex(list=code_block_176.PerimetercurveCells_Cells, index=flatten_92)
flatten_93 = List.Flatten(list=code_block_168)
eq_35 = getItemAtIndex_148 == flatten_93  # lacing=CrossProduct
code_block_178 = CodeBlock { true; }
allIndicesOf_73 = List.AllIndicesOf(list=eq_35@L2, item=code_block_178)
flatten_94 = List.Flatten(list=allIndicesOf_73)
removeItemAtIndex_34 = List.RemoveItemAtIndex(list=flatten_93, indices=flatten_94)
code_block_179 = CodeBlock(PerimetercurveCells_Curves_Filter=getItemAtIndex_147, PerimetercurveCells_Cells_Filter=getItemAtIndex_148, PerimetercurveCells_Restant_Filter=removeItemAtIndex_34, AlleCellen=code_block_168) { PerimetercurveCells_Curves_Filter; PerimetercurveCells_Cells_Filter; PerimetercurveCells_Restant_Filter; AlleCellen; }
flatten_95 = List.Flatten(list=code_block_179.AlleCellen)
length_17 = Curve.Length(curve=code_block_179.PerimetercurveCells_Curves_Filter)
round_2 = Math.Round(number=length_17)
eq_36 = round_2 == code_block_153
code_block_180 = CodeBlock { true; }
allIndicesOf_74 = List.AllIndicesOf(list=eq_36@L2, item=code_block_180)
eq_37 = round_2 == code_block_154
allIndicesOf_75 = List.AllIndicesOf(list=eq_37@L2, item=code_block_180)
flatten_96 = List.Flatten(list=allIndicesOf_75@L1)
create_5 = List.Create(item0=flatten_96)
flatten_97 = List.Flatten(list=create_5)
isEmpty_2 = List.IsEmpty(list=allIndicesOf_74@L2)
allIndicesOf_76 = List.AllIndicesOf(list=isEmpty_2@L2, item=code_block_180)
create_6 = List.Create(item0=allIndicesOf_76)
flatten_98 = List.Flatten(list=create_6)
python_script_3 = Python(IN[0]=allIndicesOf_74, IN[1]=flatten_97, IN[2]=flatten_98)  # IronPython2; same code as python_script
flatten_99 = List.Flatten(list=python_script_3)
flatten_100 = List.Flatten(list=flatten_99@L1)
getItemAtIndex_149 = List.GetItemAtIndex(list=code_block_179.PerimetercurveCells_Curves_Filter@L2, index=flatten_100, lacing=Shortest)
length_18 = Curve.Length(curve=getItemAtIndex_149)
code_block_181 = CodeBlock(x=length_18) { x/2; }
pointAtSegmentLength_8 = Curve.PointAtSegmentLength(curve=getItemAtIndex_149, segmentLength=code_block_181)
flatten_101 = List.Flatten(list=pointAtSegmentLength_8)
pruneDuplicates_11 = Point.PruneDuplicates(points=flatten_101)
doesIntersect_32 = Geometry.DoesIntersect(geometry=pruneDuplicates_11, other=flatten_95, lacing=CrossProduct)
code_block_182 = CodeBlock { true; }
allIndicesOf_77 = List.AllIndicesOf(list=doesIntersect_32@L2, item=code_block_182)
getItemAtIndex_150 = List.GetItemAtIndex(list=flatten_95, index=allIndicesOf_77)
flatten_102 = List.Flatten(list=getItemAtIndex_150)
uniqueItems_4 = List.UniqueItems(list=flatten_102)
allIndicesOf_78 = List.AllIndicesOf(list=flatten_102, item=uniqueItems_4)
firstItem_12 = List.FirstItem(list=allIndicesOf_78@L2)
flatten_103 = List.Flatten(list=allIndicesOf_77)
removeItemAtIndex_35 = List.RemoveItemAtIndex(list=flatten_95, indices=flatten_103)
count_22 = List.Count(list=allIndicesOf_78@L2)
code_block_183 = CodeBlock { 2; }
ge_7 = count_22 >= code_block_183
code_block_184 = CodeBlock { true; }
allIndicesOf_79 = List.AllIndicesOf(list=ge_7, item=code_block_184)
getItemAtIndex_151 = List.GetItemAtIndex(list=allIndicesOf_78, index=allIndicesOf_79)
lastItem_6 = List.LastItem(list=getItemAtIndex_151@L2)
getItemAtIndex_152 = List.GetItemAtIndex(list=flatten_102, index=lastItem_6)
eq_38 = getItemAtIndex_152 == getItemAtIndex_150  # lacing=CrossProduct
allFalse_3 = List.AllFalse(list=eq_38@L2)
count_23 = List.Count(list=getItemAtIndex_150)
chop_13 = List.Chop(list=allFalse_3, lengths=count_23)
code_block_185 = CodeBlock { false; }
allIndicesOf_80 = List.AllIndicesOf(list=chop_13@L2, item=code_block_185)
flatten_104 = List.Flatten(list=allIndicesOf_80)
removeItemAtIndex_36 = List.RemoveItemAtIndex(list=getItemAtIndex_150, indices=flatten_104)
byUnion_4 = Surface.ByUnion(surfaces=removeItemAtIndex_36)
getItemAtIndex_153 = List.GetItemAtIndex(list=getItemAtIndex_150, index=flatten_104)
eq_39 = getItemAtIndex_152 == getItemAtIndex_153  # lacing=CrossProduct
allFalse_4 = List.AllFalse(list=eq_39@L2)
count_24 = List.Count(list=eq_39@L3)
chop_14 = List.Chop(list=allFalse_4, lengths=count_24)
code_block_186 = CodeBlock { true; }
allIndicesOf_81 = List.AllIndicesOf(list=chop_14@L2, item=code_block_186)
removeItemAtIndex_37 = List.RemoveItemAtIndex(list=getItemAtIndex_153, indices=allIndicesOf_81)
flatten_105 = List.Flatten(list=removeItemAtIndex_37@L3)
uniqueItems_5 = List.UniqueItems(list=flatten_105@L2)
byUnion_5 = Surface.ByUnion(surfaces=uniqueItems_5)
list_create_41 = List.Create(item0=removeItemAtIndex_35, item1=byUnion_4, item2=byUnion_5)
flatten_106 = List.Flatten(list=list_create_41)
isNull_10 = Object.IsNull(object=flatten_106)
code_block_187 = CodeBlock { true; }
allIndicesOf_82 = List.AllIndicesOf(list=isNull_10, item=code_block_187)
removeItemAtIndex_38 = List.RemoveItemAtIndex(list=flatten_106, indices=allIndicesOf_82)
doesIntersect_33 = Geometry.DoesIntersect(geometry=code_block_145, other=removeItemAtIndex_38, lacing=CrossProduct)
code_block_188 = CodeBlock { true; }
allIndicesOf_83 = List.AllIndicesOf(list=doesIntersect_33@L2, item=code_block_188)
getItemAtIndex_154 = List.GetItemAtIndex(list=removeItemAtIndex_38, index=allIndicesOf_83)
code_block_189 = CodeBlock(AlleCellen=getItemAtIndex_154) { AlleCellen; }
code_block_190 = CodeBlock(KavelSurfaces=code_block_144) { KavelSurfaces; }
perimeterCurves_9 = Surface.PerimeterCurves(surface=code_block_190)
byJoinedCurves_5 = PolyCurve.ByJoinedCurves(curves=perimeterCurves_9)
doesIntersect_34 = Geometry.DoesIntersect(geometry=byJoinedCurves_5, other=code_block_189, lacing=Longest)
code_block_191 = CodeBlock { true; }
allIndicesOf_84 = List.AllIndicesOf(list=doesIntersect_34@L2, item=code_block_191)
getItemAtIndex_155 = List.GetItemAtIndex(list=code_block_189@L2, index=allIndicesOf_84, lacing=Shortest)
perimeterCurves_10 = Surface.PerimeterCurves(surface=getItemAtIndex_155)
length_19 = Curve.Length(curve=perimeterCurves_10)
code_block_192 = CodeBlock(x=length_19) { x/2; }
pointAtSegmentLength_9 = Curve.PointAtSegmentLength(curve=perimeterCurves_10, segmentLength=code_block_192)
doesIntersect_35 = Geometry.DoesIntersect(geometry=pointAtSegmentLength_9, other=byJoinedCurves_5)
code_block_193 = CodeBlock { true; }
allIndicesOf_85 = List.AllIndicesOf(list=doesIntersect_35@L2, item=code_block_193)
removeItemAtIndex_39 = List.RemoveItemAtIndex(list=perimeterCurves_10@L2, indices=allIndicesOf_85, lacing=Shortest)
count_25 = List.Count(list=removeItemAtIndex_39@L2)
code_block_194 = CodeBlock { 2; }
eq_40 = count_25 == code_block_194
code_block_195 = CodeBlock { true; }
allIndicesOf_86 = List.AllIndicesOf(list=eq_40, item=code_block_195)
getItemAtIndex_156 = List.GetItemAtIndex(list=removeItemAtIndex_39, index=allIndicesOf_86)
flatten_107 = List.Flatten(list=getItemAtIndex_155)
getItemAtIndex_157 = List.GetItemAtIndex(list=flatten_107, index=allIndicesOf_86)
flatten_108 = List.Flatten(list=code_block_189)
eq_41 = getItemAtIndex_157 == flatten_108  # lacing=CrossProduct
code_block_196 = CodeBlock { true; }
allIndicesOf_87 = List.AllIndicesOf(list=eq_41@L2, item=code_block_196)
flatten_109 = List.Flatten(list=allIndicesOf_87)
removeItemAtIndex_40 = List.RemoveItemAtIndex(list=flatten_108, indices=flatten_109)
code_block_197 = CodeBlock(PerimetercurveCells_Curves=getItemAtIndex_156, PerimetercurveCells_Cells=getItemAtIndex_157, PerimetercurveCells_Restant=removeItemAtIndex_40) { PerimetercurveCells_Curves; PerimetercurveCells_Cells; PerimetercurveCells_Restant; }
area_5 = Surface.Area(surface=code_block_197.PerimetercurveCells_Cells)
sort_17 = List.Sort(list=area_5)
le_6 = sort_17 <= mul_4
code_block_198 = CodeBlock { true; }
allIndicesOf_88 = List.AllIndicesOf(list=le_6, item=code_block_198)
getItemAtIndex_158 = List.GetItemAtIndex(list=sort_17, index=allIndicesOf_88)
allIndicesOf_89 = List.AllIndicesOf(list=area_5, item=getItemAtIndex_158)
flatten_110 = List.Flatten(list=allIndicesOf_89)
getItemAtIndex_159 = List.GetItemAtIndex(list=code_block_197.PerimetercurveCells_Curves, index=flatten_110)
getItemAtIndex_160 = List.GetItemAtIndex(list=code_block_197.PerimetercurveCells_Cells, index=flatten_110)
flatten_111 = List.Flatten(list=code_block_189)
eq_42 = getItemAtIndex_160 == flatten_111  # lacing=CrossProduct
code_block_199 = CodeBlock { true; }
allIndicesOf_90 = List.AllIndicesOf(list=eq_42@L2, item=code_block_199)
flatten_112 = List.Flatten(list=allIndicesOf_90)
removeItemAtIndex_41 = List.RemoveItemAtIndex(list=flatten_111, indices=flatten_112)
code_block_200 = CodeBlock(PerimetercurveCells_Curves_Filter=getItemAtIndex_159, PerimetercurveCells_Cells_Filter=getItemAtIndex_160, PerimetercurveCells_Restant_Filter=removeItemAtIndex_41, AlleCellen=code_block_189) { PerimetercurveCells_Curves_Filter; PerimetercurveCells_Cells_Filter; PerimetercurveCells_Restant_Filter; AlleCellen; }
flatten_113 = List.Flatten(list=code_block_200.AlleCellen)
length_20 = Curve.Length(curve=code_block_200.PerimetercurveCells_Curves_Filter)
sort_18 = List.Sort(list=length_20)
lastItem_7 = List.LastItem(list=sort_18@L2)
allIndicesOf_91 = List.AllIndicesOf(list=length_20, item=lastItem_7, lacing=Shortest)
getItemAtIndex_161 = List.GetItemAtIndex(list=code_block_200.PerimetercurveCells_Curves_Filter@L2, index=allIndicesOf_91, lacing=Shortest)
firstItem_13 = List.FirstItem(list=getItemAtIndex_161@L2)
flatten_114 = List.Flatten(list=firstItem_13@L1)
length_21 = Curve.Length(curve=flatten_114)
code_block_201 = CodeBlock(x=length_21) { x/2; }
pointAtSegmentLength_10 = Curve.PointAtSegmentLength(curve=flatten_114, segmentLength=code_block_201)
flatten_115 = List.Flatten(list=pointAtSegmentLength_10)
pruneDuplicates_12 = Point.PruneDuplicates(points=flatten_115)
doesIntersect_36 = Geometry.DoesIntersect(geometry=pruneDuplicates_12, other=flatten_113, lacing=CrossProduct)
code_block_202 = CodeBlock { true; }
allIndicesOf_92 = List.AllIndicesOf(list=doesIntersect_36@L2, item=code_block_202)
getItemAtIndex_162 = List.GetItemAtIndex(list=flatten_113, index=allIndicesOf_92)
flatten_116 = List.Flatten(list=getItemAtIndex_162)
uniqueItems_6 = List.UniqueItems(list=flatten_116)
allIndicesOf_93 = List.AllIndicesOf(list=flatten_116, item=uniqueItems_6)
firstItem_14 = List.FirstItem(list=allIndicesOf_93@L2)
count_26 = List.Count(list=allIndicesOf_93@L2)
code_block_203 = CodeBlock { 2; }
ge_8 = count_26 >= code_block_203
code_block_204 = CodeBlock { true; }
allIndicesOf_94 = List.AllIndicesOf(list=ge_8, item=code_block_204)
getItemAtIndex_163 = List.GetItemAtIndex(list=allIndicesOf_93, index=allIndicesOf_94)
lastItem_8 = List.LastItem(list=getItemAtIndex_163@L2)
getItemAtIndex_164 = List.GetItemAtIndex(list=flatten_116, index=lastItem_8)
eq_43 = getItemAtIndex_164 == getItemAtIndex_162  # lacing=CrossProduct
allFalse_5 = List.AllFalse(list=eq_43@L2)
count_27 = List.Count(list=getItemAtIndex_162)
chop_15 = List.Chop(list=allFalse_5, lengths=count_27)
code_block_205 = CodeBlock { false; }
allIndicesOf_95 = List.AllIndicesOf(list=chop_15@L2, item=code_block_205)
flatten_117 = List.Flatten(list=allIndicesOf_95)
getItemAtIndex_165 = List.GetItemAtIndex(list=getItemAtIndex_162, index=flatten_117)
eq_44 = getItemAtIndex_164 == getItemAtIndex_165  # lacing=CrossProduct
allFalse_6 = List.AllFalse(list=eq_44@L2)
count_28 = List.Count(list=eq_44@L3)
chop_16 = List.Chop(list=allFalse_6, lengths=count_28)
code_block_206 = CodeBlock { true; }
allIndicesOf_96 = List.AllIndicesOf(list=chop_16@L2, item=code_block_206)
removeItemAtIndex_42 = List.RemoveItemAtIndex(list=getItemAtIndex_165, indices=allIndicesOf_96)
flatten_118 = List.Flatten(list=removeItemAtIndex_42@L3)
uniqueItems_7 = List.UniqueItems(list=flatten_118@L2)
eq_45 = getItemAtIndex_164 == uniqueItems_7  # lacing=CrossProduct
countTrue_5 = List.CountTrue(list=eq_45@L3)
code_block_207 = CodeBlock { 2; }
ge_9 = countTrue_5 >= code_block_207
code_block_208 = CodeBlock { true; }
allIndicesOf_97 = List.AllIndicesOf(list=ge_9, item=code_block_208)
getItemAtIndex_166 = List.GetItemAtIndex(list=uniqueItems_7, index=allIndicesOf_97)
flatten_119 = List.Flatten(list=getItemAtIndex_166)
uniqueItems_8 = List.UniqueItems(list=flatten_119)
doesIntersect_37 = Geometry.DoesIntersect(geometry=getItemAtIndex_164, other=uniqueItems_8, lacing=CrossProduct)
allTrue_11 = List.AllTrue(list=doesIntersect_37@L2)
flatten_120 = List.Flatten(list=allIndicesOf_92)
removeItemAtIndex_43 = List.RemoveItemAtIndex(list=flatten_113, indices=flatten_120)
removeItemAtIndex_44 = List.RemoveItemAtIndex(list=getItemAtIndex_162, indices=flatten_117)
byUnion_6 = Surface.ByUnion(surfaces=removeItemAtIndex_44)
removeItemAtIndex_45 = List.RemoveItemAtIndex(list=uniqueItems_7, indices=allIndicesOf_97)
byUnion_7 = Surface.ByUnion(surfaces=removeItemAtIndex_45)
code_block_209 = CodeBlock { 4; }
countTrue_6 = List.CountTrue(list=doesIntersect_37@L2)
eq_46 = code_block_209 == countTrue_6
code_block_210 = CodeBlock { true; }
allIndicesOf_98 = List.AllIndicesOf(list=eq_46, item=code_block_210)
getItemAtIndex_167 = List.GetItemAtIndex(list=getItemAtIndex_164, index=allIndicesOf_98)
doesIntersect_38 = Geometry.DoesIntersect(geometry=getItemAtIndex_167, other=uniqueItems_8, lacing=CrossProduct)
code_block_211 = CodeBlock { true; }
allIndicesOf_99 = List.AllIndicesOf(list=doesIntersect_38@L2, item=code_block_211)
getItemAtIndex_168 = List.GetItemAtIndex(list=uniqueItems_8, index=allIndicesOf_99)
byUnion_8 = Surface.ByUnion(surfaces=getItemAtIndex_168)
list_create_42 = List.Create(item0=removeItemAtIndex_43, item1=byUnion_6, item2=byUnion_7, item3=byUnion_8)
flatten_121 = List.Flatten(list=list_create_42)
isNull_11 = Object.IsNull(object=flatten_121)
code_block_212 = CodeBlock { true; }
allIndicesOf_100 = List.AllIndicesOf(list=isNull_11, item=code_block_212)
removeItemAtIndex_46 = List.RemoveItemAtIndex(list=flatten_121, indices=allIndicesOf_100)
doesIntersect_39 = Geometry.DoesIntersect(geometry=code_block_145, other=removeItemAtIndex_46, lacing=CrossProduct)
code_block_213 = CodeBlock { true; }
allIndicesOf_101 = List.AllIndicesOf(list=doesIntersect_39@L2, item=code_block_213)

getItemAtIndex_169 = List.GetItemAtIndex(list=removeItemAtIndex_46, index=allIndicesOf_101)
perimeterCurves_11 = Surface.PerimeterCurves(surface=getItemAtIndex_169)
flatten_122 = List.Flatten(list=getItemAtIndex_169)
area_6 = Surface.Area(surface=flatten_122)
sum_2 = Math.Sum(values=area_6)
controleM2 = Watch(sum_2)  # graph output
code_block_214 = CodeBlock(CellCleanUp_Surfaces=getItemAtIndex_169) { CellCleanUp_Surfaces; }
offset_Cells = IntegerSlider(2500, range=100..6000 step 100)  # graph input
code_block_215 = CodeBlock { true; }
ZAxis = Vector.ZAxis()
code_block_216 = CodeBlock { 180; }
code_block_217 = CodeBlock { true; }
code_block_218 = CodeBlock { 90; }
code_block_219 = CodeBlock { true; }
code_block_220 = CodeBlock { -10; }
code_block_221 = CodeBlock { true; }
ZAxis_2 = Vector.ZAxis()
code_block_222 = CodeBlock { 180; }
code_block_223 = CodeBlock { true; }
code_block_224 = CodeBlock { 90; }
code_block_225 = CodeBlock { true; }
code_block_226 = CodeBlock { 3; }
code_block_227 = CodeBlock { true; }
treshold_BiggestRectangle = IntegerSlider(2, range=1..25 step 1)  # graph input
code_block_228 = CodeBlock { 0.5; }
code_block_229 = CodeBlock { 0.5; }
code_block_230 = CodeBlock { 10000; }
code_block_231 = CodeBlock(NietBruikbareSurfacess=removeItemAtIndex_23) { NietBruikbareSurfacess; }
perimeterCurves_12 = Surface.PerimeterCurves(surface=code_block_231)
byJoinedCurves_6 = PolyCurve.ByJoinedCurves(curves=perimeterCurves_12)
byPatch_4 = Surface.ByPatch(closedCurve=byJoinedCurves_6)
code_block_232 = CodeBlock { 0; 1; }
code_block_233 = CodeBlock { "line"; }
code_block_234 = CodeBlock { true; }
code_block_235 = CodeBlock { false; }
code_block_236 = CodeBlock { 10000; }
code_block_237 = CodeBlock { 2; 1; 3; 0; }
code_block_238 = CodeBlock { false; }
code_block_239 = CodeBlock { true; }
code_block_240 = CodeBlock { 10; }
code_block_241 = CodeBlock { true; }
code_block_242 = CodeBlock { true; }
code_block_243 = CodeBlock { 1; }
code_block_244 = CodeBlock { true; }
code_block_245 = CodeBlock { 0; }
code_block_246 = CodeBlock { false; }
code_block_247 = CodeBlock { 1; }
code_block_248 = CodeBlock { 0; 1; 2; 3; }
code_block_249 = CodeBlock { 0; }
code_block_250 = CodeBlock { 4; }
code_block_251 = CodeBlock { true; }
code_block_252 = CodeBlock { true; }
ZAxis_3 = Vector.ZAxis()
code_block_253 = CodeBlock { 180; }
code_block_254 = CodeBlock { true; }
code_block_255 = CodeBlock { 90; }
code_block_256 = CodeBlock { true; }
code_block_257 = CodeBlock(CellWidth=cellWidth) { CellWidth; }

# group: Offset de kavels naar binnen
# Zorgt ervoor dat als de kavels niet meer maakbaar zijn met de gekozen offset afstand, dat deze kavels toegevoegd worden aan het groen
flatten_123 = List.Flatten(list=code_block_214)
perimeterCurves_13 = Surface.PerimeterCurves(surface=flatten_123)
byJoinedCurves_7 = PolyCurve.ByJoinedCurves(curves=perimeterCurves_13)
code_block_258 = CodeBlock(x=offset_Cells) { -x; }
offset_5 = Curve.Offset(curve=byJoinedCurves_7, distance=code_block_258)
isNull_12 = Object.IsNull(object=offset_5)
code_block_259 = CodeBlock { true; }
allIndicesOf_102 = List.AllIndicesOf(list=isNull_12, item=code_block_259)
getItemAtIndex_170 = List.GetItemAtIndex(list=flatten_123, index=allIndicesOf_102)
code_block_260 = CodeBlock(x=offset_Cells) { x*2; }
sub = code_block_257 - code_block_260

removeItemAtIndex_47 = List.RemoveItemAtIndex(list=offset_5, indices=allIndicesOf_102)
byPatch_5 = Surface.ByPatch(closedCurve=removeItemAtIndex_47)
code_block_261 = CodeBlock(surfaces=byPatch_5) { surfaces; }
code_block_262 = CodeBlock(surfaces=code_block_261) { surfaces; }
perimeterCurves_14 = Surface.PerimeterCurves(surface=code_block_262)
flatten_124 = List.Flatten(list=perimeterCurves_14)
startPoint_31 = Curve.StartPoint(curve=perimeterCurves_14)
flatten_125 = List.Flatten(list=startPoint_31)
doesIntersect_40 = Geometry.DoesIntersect(geometry=flatten_125, other=flatten_124, lacing=CrossProduct)
allIndicesOf_103 = List.AllIndicesOf(list=doesIntersect_40@L2, item=code_block_215)
getItemAtIndex_171 = List.GetItemAtIndex(list=flatten_124, index=allIndicesOf_103)
direction = Line.Direction(line=getItemAtIndex_171)
firstItem_15 = List.FirstItem(list=direction@L2)
lastItem_9 = List.LastItem(list=direction@L2)
angleAboutAxis = Vector.AngleAboutAxis(vector=firstItem_15, otherVector=lastItem_9, rotationAxis=ZAxis)
ge_10 = angleAboutAxis >= code_block_216
allIndicesOf_104 = List.AllIndicesOf(list=ge_10, item=code_block_217)
getItemAtIndex_172 = List.GetItemAtIndex(list=angleAboutAxis, index=allIndicesOf_104)
code_block_263 = CodeBlock(x=getItemAtIndex_172) { 360-x; }
python_script_4 = Python(IN[0]=angleAboutAxis, IN[1]=code_block_263, IN[2]=allIndicesOf_104)  # IronPython2; same code as python_script
count_29 = List.Count(list=startPoint_31@L2)
chop_17 = List.Chop(list=python_script_4, lengths=count_29)
round_3 = Math.Round(number=chop_17)
eq_47 = round_3 == code_block_218
allTrue_12 = List.AllTrue(list=eq_47@L2)
allIndicesOf_105 = List.AllIndicesOf(list=allTrue_12, item=code_block_219)
removeItemAtIndex_48 = List.RemoveItemAtIndex(list=code_block_262, indices=allIndicesOf_105)
perimeterCurves_15 = Surface.PerimeterCurves(surface=removeItemAtIndex_48)
length_22 = Curve.Length(curve=perimeterCurves_15)
sort_19 = List.Sort(list=length_22)
lastItem_10 = List.LastItem(list=sort_19@L2)
extendStart = Curve.ExtendStart(curve=perimeterCurves_15, distance=lastItem_10)
extendEnd_4 = Curve.ExtendEnd(curve=extendStart, distance=lastItem_10)
geometrySplit_3 = Geometry.Intersection.GeometrySplit(geometry=removeItemAtIndex_48, cutting=extendEnd_4, lacing=Shortest)
flatten_126 = List.Flatten(list=geometrySplit_3)
perimeterCurves_16 = Surface.PerimeterCurves(surface=flatten_126)
byJoinedCurves_8 = PolyCurve.ByJoinedCurves(curves=perimeterCurves_16)
offset_6 = Curve.Offset(curve=byJoinedCurves_8, distance=code_block_220)
byPatch_6 = Surface.ByPatch(closedCurve=offset_6)
perimeterCurves_17 = Surface.PerimeterCurves(surface=byPatch_6)
flatten_127 = List.Flatten(list=perimeterCurves_17)
startPoint_32 = Curve.StartPoint(curve=perimeterCurves_17)
flatten_128 = List.Flatten(list=startPoint_32)
doesIntersect_41 = Geometry.DoesIntersect(geometry=flatten_128, other=flatten_127, lacing=CrossProduct)
allIndicesOf_106 = List.AllIndicesOf(list=doesIntersect_41@L2, item=code_block_221)
getItemAtIndex_173 = List.GetItemAtIndex(list=flatten_127, index=allIndicesOf_106)
direction_2 = Line.Direction(line=getItemAtIndex_173)
firstItem_16 = List.FirstItem(list=direction_2@L2)
lastItem_11 = List.LastItem(list=direction_2@L2)
angleAboutAxis_2 = Vector.AngleAboutAxis(vector=firstItem_16, otherVector=lastItem_11, rotationAxis=ZAxis_2)
ge_11 = angleAboutAxis_2 >= code_block_222
allIndicesOf_107 = List.AllIndicesOf(list=ge_11, item=code_block_223)
getItemAtIndex_174 = List.GetItemAtIndex(list=angleAboutAxis_2, index=allIndicesOf_107)
code_block_264 = CodeBlock(x=getItemAtIndex_174) { 360-x; }
python_script_5 = Python(IN[0]=angleAboutAxis_2, IN[1]=code_block_264, IN[2]=allIndicesOf_107)  # IronPython2; same code as python_script
count_30 = List.Count(list=startPoint_32@L2)
chop_18 = List.Chop(list=python_script_5, lengths=count_30)
round_4 = Math.Round(number=chop_18)
eq_48 = round_4 == code_block_224
allTrue_13 = List.AllTrue(list=eq_48@L2)
allIndicesOf_108 = List.AllIndicesOf(list=allTrue_13, item=code_block_225)
removeItemAtIndex_49 = List.RemoveItemAtIndex(list=flatten_126, indices=allIndicesOf_108)
code_block_265 = CodeBlock(teszt=removeItemAtIndex_49) { teszt: var[]..[]; }
perimeterCurves_18 = Surface.PerimeterCurves(surface=code_block_265)
count_31 = List.Count(list=perimeterCurves_18@L2)
eq_49 = count_31 == code_block_226
allIndicesOf_109 = List.AllIndicesOf(list=eq_49, item=code_block_227)
removeItemAtIndex_50 = List.RemoveItemAtIndex(list=code_block_265, indices=allIndicesOf_109)
code_block_266 = CodeBlock(Inputsurfaces=removeItemAtIndex_50) { Inputsurfaces; }
code_block_267 = CodeBlock(teszt=code_block_266) { teszt; }
code_block_268 = CodeBlock(surfaces=code_block_267) { surfaces; }

# group: Gecontroleerd
code_block_269 = CodeBlock { 0; 1; }
range = Range(start=code_block_269.out0, end=treshold_BiggestRectangle, step=code_block_269.out1)
code_block_270 = CodeBlock(x=range) { -x; }
join_10 = List.Join(list0=range, list1=code_block_270)
uniqueItems_9 = List.UniqueItems(list=join_10)
sort_20 = List.Sort(list=uniqueItems_9)
count_32 = List.Count(list=sort_20)
cycle_9 = List.Cycle(list=code_block_267, amount=count_32)
perimeterCurves_19 = Surface.PerimeterCurves(surface=code_block_267)
length_23 = Curve.Length(curve=perimeterCurves_19)
sort_21 = List.Sort(list=length_23)
lastItem_12 = List.LastItem(list=sort_21@L2)
indexOf_15 = List.IndexOf(list=length_23@L2, element=lastItem_12, lacing=Shortest)
getItemAtIndex_175 = List.GetItemAtIndex(list=perimeterCurves_19, index=indexOf_15, lacing=Shortest)
count_33 = List.Count(list=getItemAtIndex_175)
chop_19 = List.Chop(list=cycle_9, lengths=count_33)
transpose_20 = List.Transpose(lists=chop_19)
cycle_10 = List.Cycle(list=getItemAtIndex_175, amount=count_32)
chop_20 = List.Chop(list=cycle_10, lengths=count_33)
transpose_21 = List.Transpose(lists=chop_20)
ZAxis_4 = Vector.ZAxis()
cycle_11 = List.Cycle(list=ZAxis_4, amount=count_32)
cycle_12 = List.Cycle(list=cycle_11, amount=count_33)
chop_21 = List.Chop(list=cycle_12, lengths=count_32)
cycle_13 = List.Cycle(list=sort_20, amount=count_33)
chop_22 = List.Chop(list=cycle_13, lengths=count_32)
code_block_271 = CodeBlock { 0.5; }
identity_2 = CoordinateSystem.Identity()
cycle_14 = List.Cycle(list=identity_2, amount=count_32)
cycle_15 = List.Cycle(list=cycle_14, amount=count_33)
chop_23 = List.Chop(list=cycle_15, lengths=count_33)
transpose_22 = List.Transpose(lists=chop_23)
code_block_272 = CodeBlock { 0; }

cycle_16 = List.Cycle(list=code_block_268, amount=count_32)
count_34 = List.Count(list=code_block_268)
chop_24 = List.Chop(list=cycle_16, lengths=count_34)
transpose_23 = List.Transpose(lists=chop_24)
flatten_129 = List.Flatten(list=transpose_23)
flatten_130 = List.Flatten(list=flatten_129@L1)
code_block_273 = CodeBlock(curve=transpose_21) { curve; }
length_24 = Curve.Length(curve=code_block_273)
code_block_274 = CodeBlock(x=length_24) { x/2; }
pointAtSegmentLength_11 = Curve.PointAtSegmentLength(curve=code_block_273, segmentLength=code_block_274)

# group (continued): Gecontroleerd
rotate = Geometry.Rotate(geometry=transpose_21, origin=pointAtSegmentLength_11, axis=chop_21, degrees=chop_22, lacing=Shortest)
coordinateSystemAtParameter_2 = Curve.CoordinateSystemAtParameter(curve=rotate, param=code_block_271)
transform_3 = Geometry.Transform(geometry=transpose_20, fromCoordinateSystem=coordinateSystemAtParameter_2, contextCoordinateSystem=transpose_22, lacing=Shortest)
flatten_131 = List.Flatten(list=transform_3)
byGeometry_2 = BoundingBox.ByGeometry(geom=flatten_131, lacing=Shortest)
chop_25 = List.Chop(list=byGeometry_2, lengths=count_32)
code_block_275 = CodeBlock(bb=chop_25, z=code_block_272)  # same code as code_block_136
transform_4 = Geometry.Transform(geometry=code_block_275.r1, fromCoordinateSystem=transpose_22, contextCoordinateSystem=coordinateSystemAtParameter_2)

byPatch_7 = Surface.ByPatch(closedCurve=transform_4)
flatten_132 = List.Flatten(list=byPatch_7)
perimeterCurves_20 = Surface.PerimeterCurves(surface=code_block_267)
startPoint_33 = Curve.StartPoint(curve=perimeterCurves_20)
flatten_133 = List.Flatten(list=startPoint_33)
cycle_17 = List.Cycle(list=flatten_133, amount=count_32)
count_35 = List.Count(list=flatten_133)
chop_26 = List.Chop(list=cycle_17, lengths=count_35)
count_36 = List.Count(list=startPoint_33@L2)
chop_27 = List.Chop(list=chop_26@L2, lengths=count_36)
transpose_24 = List.Transpose(lists=chop_27@L4)
transpose_25 = List.Transpose(lists=transpose_24@L3)
curves = PolyCurve.Curves(polyCurve=transform_4)
flatten_134 = List.Flatten(list=curves@L2)
length_25 = Curve.Length(curve=flatten_134)
sort_22 = List.Sort(list=length_25)
lastItem_13 = List.LastItem(list=sort_22@L2)
allIndicesOf_110 = List.AllIndicesOf(list=length_25@L2, item=lastItem_13, lacing=Shortest)
getItemAtIndex_176 = List.GetItemAtIndex(list=flatten_134, index=allIndicesOf_110, lacing=Shortest)
normalAtParameter = Curve.NormalAtParameter(curve=getItemAtIndex_176, param=code_block_228)
X = Vector.X(vector=normalAtParameter)
sort_23 = List.Sort(list=X)
firstItem_17 = List.FirstItem(list=sort_23@L2)
allIndicesOf_111 = List.AllIndicesOf(list=X@L2, item=firstItem_17, lacing=Shortest)
getItemAtIndex_177 = List.GetItemAtIndex(list=getItemAtIndex_176, index=allIndicesOf_111, lacing=Shortest)
flatten_135 = List.Flatten(list=getItemAtIndex_177)
chop_28 = List.Chop(list=flatten_135, lengths=count_32)
lastItem_14 = List.LastItem(list=sort_23@L2)
allIndicesOf_112 = List.AllIndicesOf(list=X@L2, item=lastItem_14, lacing=Shortest)
getItemAtIndex_178 = List.GetItemAtIndex(list=getItemAtIndex_176, index=allIndicesOf_112, lacing=Shortest)
flatten_136 = List.Flatten(list=getItemAtIndex_178)
chop_29 = List.Chop(list=flatten_136, lengths=count_32)
firstItem_18 = List.FirstItem(list=sort_22@L2)
allIndicesOf_113 = List.AllIndicesOf(list=length_25@L2, item=firstItem_18, lacing=Shortest)
getItemAtIndex_179 = List.GetItemAtIndex(list=flatten_134, index=allIndicesOf_113, lacing=Shortest)
normalAtParameter_2 = Curve.NormalAtParameter(curve=getItemAtIndex_179, param=code_block_229)
Y = Vector.Y(vector=normalAtParameter_2)
sort_24 = List.Sort(list=Y)
firstItem_19 = List.FirstItem(list=sort_24@L2)
allIndicesOf_114 = List.AllIndicesOf(list=Y@L2, item=firstItem_19, lacing=Shortest)
getItemAtIndex_180 = List.GetItemAtIndex(list=getItemAtIndex_179, index=allIndicesOf_114, lacing=Shortest)
flatten_137 = List.Flatten(list=getItemAtIndex_180)
chop_30 = List.Chop(list=flatten_137, lengths=count_32)
lastItem_15 = List.LastItem(list=sort_24@L2)
allIndicesOf_115 = List.AllIndicesOf(list=Y@L2, item=lastItem_15, lacing=Shortest)
getItemAtIndex_181 = List.GetItemAtIndex(list=getItemAtIndex_179, index=allIndicesOf_115, lacing=Shortest)
flatten_138 = List.Flatten(list=getItemAtIndex_181)
chop_31 = List.Chop(list=flatten_138, lengths=count_32)
code_block_276 = CodeBlock(linkerlijn=chop_28, rechterlijn=chop_29, onderlijn=chop_30, bovelijn=chop_31) { linkerlijn; rechterlijn; onderlijn; bovelijn; }
startPoint_34 = Curve.StartPoint(curve=code_block_276.linkerlijn)
reverse_5 = Curve.Reverse(curve=code_block_276.rechterlijn)
startPoint_35 = Curve.StartPoint(curve=reverse_5)
byTwoPoints_12 = Vector.ByTwoPoints(start=startPoint_34, end=startPoint_35)
startPoint_36 = Curve.StartPoint(curve=code_block_276.onderlijn)
reverse_6 = Curve.Reverse(curve=code_block_276.bovelijn)
startPoint_37 = Curve.StartPoint(curve=reverse_6)
byTwoPoints_13 = Vector.ByTwoPoints(start=startPoint_36, end=startPoint_37)
code_block_277 = CodeBlock(vector_linksrechts=byTwoPoints_12, vector_onderboven=byTwoPoints_13) { vector_linksrechts; vector_onderboven; }
cycle_18 = List.Cycle(list=code_block_277.vector_linksrechts, amount=count_36, lacing=Shortest)
count_37 = List.Count(list=code_block_277.vector_linksrechts@L2)
chop_32 = List.Chop(list=cycle_18@L2, lengths=count_37)
count_38 = List.Count(list=cycle_17)
cycle_19 = List.Cycle(list=code_block_230, amount=count_38)
chop_33 = List.Chop(list=cycle_19, lengths=count_35)
chop_34 = List.Chop(list=chop_33@L2, lengths=count_36)
transpose_26 = List.Transpose(lists=chop_34@L4)
transpose_27 = List.Transpose(lists=transpose_26@L3)
translate_4 = Geometry.Translate(geometry=transpose_25, direction=chop_32, distance=transpose_27, lacing=Shortest)
byStartPointEndPoint_30 = Line.ByStartPointEndPoint(startPoint=transpose_25, endPoint=translate_4)
length_26 = Curve.Length(curve=curves)
flatten_139 = List.Flatten(list=length_26)
sort_25 = List.Sort(list=flatten_139)
lastItem_16 = List.LastItem(list=sort_25)
cycle_20 = List.Cycle(list=lastItem_16, amount=count_38)
chop_35 = List.Chop(list=cycle_20, lengths=count_35)
chop_36 = List.Chop(list=chop_35@L2, lengths=count_36)
transpose_28 = List.Transpose(lists=chop_36@L4)
transpose_29 = List.Transpose(lists=transpose_28@L3)
extendEnd_5 = Curve.ExtendEnd(curve=byStartPointEndPoint_30, distance=transpose_29)
extendStart_2 = Curve.ExtendStart(curve=extendEnd_5, distance=transpose_29)
flatten_140 = List.Flatten(list=extendStart_2)
cycle_21 = List.Cycle(list=code_block_277.vector_onderboven, amount=count_36, lacing=Shortest)
chop_37 = List.Chop(list=cycle_21@L2, lengths=count_37)
translate_5 = Geometry.Translate(geometry=transpose_25, direction=chop_37, distance=transpose_27, lacing=Shortest)
byStartPointEndPoint_31 = Line.ByStartPointEndPoint(startPoint=transpose_25, endPoint=translate_5)
extendEnd_6 = Curve.ExtendEnd(curve=byStartPointEndPoint_31, distance=transpose_29)
extendStart_3 = Curve.ExtendStart(curve=extendEnd_6, distance=transpose_29)
flatten_141 = List.Flatten(list=extendStart_3)
list_create_43 = List.Create(item0=flatten_140, item1=flatten_141)
transpose_30 = List.Transpose(lists=list_create_43)
flatten_142 = List.Flatten(list=transpose_30@L2)
chop_38 = List.Chop(list=flatten_142, lengths=count_32)
chop_39 = List.Chop(list=chop_38, lengths=count_36)
transpose_31 = List.Transpose(lists=chop_39@L4)
flatten_143 = List.Flatten(list=transpose_31@L3)
chop_40 = List.Chop(list=flatten_143, lengths=count_37)
flatten_144 = List.Flatten(list=chop_40@L2)
geometrySplit_4 = Geometry.Intersection.GeometrySplit(geometry=flatten_132, cutting=flatten_144)
count_39 = List.Count(list=byPatch_7@L2)
chop_41 = List.Chop(list=geometrySplit_4, lengths=count_39)
flatten_145 = List.Flatten(list=chop_41@L2)
code_block_278 = CodeBlock(linkerlijn=code_block_276.linkerlijn, rechterlijn=code_block_276.rechterlijn, onderlijn=code_block_276.onderlijn, bovelijn=code_block_276.bovelijn) { linkerlijn; rechterlijn; onderlijn; bovelijn; }
flatten_146 = List.Flatten(list=code_block_278.linkerlijn)
flatten_147 = List.Flatten(list=flatten_146@L1)
flatten_148 = List.Flatten(list=code_block_278.bovelijn)
flatten_149 = List.Flatten(list=flatten_148@L1)
list_create_44 = List.Create(item0=flatten_130, item1=flatten_145, item2=flatten_147, item3=flatten_149)
transpose_32 = List.Transpose(lists=list_create_44)
getItemAtIndex_182 = List.GetItemAtIndex(list=code_block_265, index=allIndicesOf_109)
code_block_279 = CodeBlock(surfaces=code_block_267) { surfaces; }
cycle_22 = List.Cycle(list=code_block_279, amount=count_32)
count_40 = List.Count(list=code_block_279)
chop_42 = List.Chop(list=cycle_22, lengths=count_40)
transpose_33 = List.Transpose(lists=chop_42)
flatten_150 = List.Flatten(list=transpose_33)
flatten_151 = List.Flatten(list=flatten_150@L1)
byPatch_8 = Surface.ByPatch(closedCurve=transform_4)
flatten_152 = List.Flatten(list=byPatch_8)
transpose_34 = List.Transpose(lists=list_create_44)
getItemAtIndex_183 = List.GetItemAtIndex(list=transpose_34@L3, index=code_block_232.out0)
flatten_153 = List.Flatten(list=getItemAtIndex_183)
perimeterCurves_21 = Surface.PerimeterCurves(surface=flatten_153)
byJoinedCurves_9 = PolyCurve.ByJoinedCurves(curves=perimeterCurves_21)
getItemAtIndex_184 = List.GetItemAtIndex(list=transpose_34@L3, index=code_block_232.out1)
perimeterCurves_22 = Surface.PerimeterCurves(surface=getItemAtIndex_184)
flatten_154 = List.Flatten(list=perimeterCurves_22@L3)
intersect_13 = Geometry.Intersect(geometry=byJoinedCurves_9, other=flatten_154, lacing=Shortest)
flatten_155 = List.Flatten(list=intersect_13@L3)
string_from_object_9 = FromObject(object=flatten_155)
contains_10 = String.Contains(string=string_from_object_9, searchFor=code_block_233, ignoreCase=code_block_234)
allIndicesOf_116 = List.AllIndicesOf(list=contains_10@L2, item=code_block_235)
getItemAtIndex_185 = List.GetItemAtIndex(list=flatten_155, index=allIndicesOf_116, lacing=Shortest)
pruneDuplicates_13 = Point.PruneDuplicates(points=getItemAtIndex_185@L2)
chop_43 = List.Chop(list=pruneDuplicates_13, lengths=count_32)
code_block_280 = CodeBlock(vector_linksrechts=byTwoPoints_12, vector_onderboven=byTwoPoints_13) { vector_linksrechts; vector_onderboven; }
flatten_156 = List.Flatten(list=code_block_280.vector_linksrechts)
flatten_157 = List.Flatten(list=flatten_156@L1)
count_41 = List.Count(list=chop_43@L2)
cycle_23 = List.Cycle(list=flatten_157, amount=count_41, lacing=Shortest)
chop_44 = List.Chop(list=cycle_23, lengths=count_32)
count_42 = List.Count(list=flatten_156)
cycle_24 = List.Cycle(list=code_block_236, amount=count_42)
flatten_158 = List.Flatten(list=cycle_24@L1)
cycle_25 = List.Cycle(list=flatten_158, amount=count_41, lacing=Shortest)
chop_45 = List.Chop(list=cycle_25, lengths=count_32)
translate_6 = Geometry.Translate(geometry=chop_43, direction=chop_44, distance=chop_45, lacing=Shortest)
byStartPointEndPoint_32 = Line.ByStartPointEndPoint(startPoint=chop_43, endPoint=translate_6)
length_27 = Curve.Length(curve=curves)
flatten_159 = List.Flatten(list=length_27)
sort_26 = List.Sort(list=flatten_159)
lastItem_17 = List.LastItem(list=sort_26)
cycle_26 = List.Cycle(list=lastItem_17, amount=count_42)
flatten_160 = List.Flatten(list=cycle_26@L1)
cycle_27 = List.Cycle(list=flatten_160, amount=count_41, lacing=Shortest)
chop_46 = List.Chop(list=cycle_27, lengths=count_32)
extendEnd_7 = Curve.ExtendEnd(curve=byStartPointEndPoint_32, distance=chop_46, lacing=Shortest)
extendStart_4 = Curve.ExtendStart(curve=extendEnd_7, distance=chop_46, lacing=Shortest)
flatten_161 = List.Flatten(list=extendStart_4)
flatten_162 = List.Flatten(list=code_block_280.vector_onderboven)
flatten_163 = List.Flatten(list=flatten_162@L1)
cycle_28 = List.Cycle(list=flatten_163, amount=count_41, lacing=Shortest)
chop_47 = List.Chop(list=cycle_28, lengths=count_32)
translate_7 = Geometry.Translate(geometry=chop_43, direction=chop_47, distance=chop_45, lacing=Shortest)
byStartPointEndPoint_33 = Line.ByStartPointEndPoint(startPoint=chop_43, endPoint=translate_7)
extendEnd_8 = Curve.ExtendEnd(curve=byStartPointEndPoint_33, distance=chop_46, lacing=Shortest)
extendStart_5 = Curve.ExtendStart(curve=extendEnd_8, distance=chop_46, lacing=Shortest)
flatten_164 = List.Flatten(list=extendStart_5)
list_create_45 = List.Create(item0=flatten_161, item1=flatten_164)
transpose_35 = List.Transpose(lists=list_create_45)
flatten_165 = List.Flatten(list=transpose_35@L2)
chop_48 = List.Chop(list=flatten_165, lengths=count_41)
chop_49 = List.Chop(list=chop_48, lengths=count_32)
flatten_166 = List.Flatten(list=chop_49@L3)
chop_50 = List.Chop(list=flatten_166, lengths=count_37)
flatten_167 = List.Flatten(list=chop_50@L2)
geometrySplit_5 = Geometry.Intersection.GeometrySplit(geometry=flatten_152, cutting=flatten_167)
count_43 = List.Count(list=byPatch_8@L2)
chop_51 = List.Chop(list=geometrySplit_5, lengths=count_43)
flatten_168 = List.Flatten(list=chop_51@L2)
code_block_281 = CodeBlock(linkerlijn=code_block_276.linkerlijn, rechterlijn=code_block_276.rechterlijn, onderlijn=code_block_276.onderlijn, bovelijn=code_block_276.bovelijn) { linkerlijn; rechterlijn; onderlijn; bovelijn; }
flatten_169 = List.Flatten(list=code_block_281.linkerlijn)
flatten_170 = List.Flatten(list=flatten_169@L1)
flatten_171 = List.Flatten(list=code_block_281.bovelijn)
flatten_172 = List.Flatten(list=flatten_171@L1)
list_create_46 = List.Create(item0=flatten_151, item1=flatten_168, item2=flatten_170, item3=flatten_172)
transpose_36 = List.Transpose(lists=list_create_46)
getItemAtIndex_186 = List.GetItemAtIndex(list=transpose_36@L3, index=code_block_237.out1)
code_block_282 = CodeBlock(allecellen=getItemAtIndex_186) { allecellen; }
getItemAtIndex_187 = List.GetItemAtIndex(list=transpose_36@L3, index=code_block_237.out0)
flatten_173 = List.Flatten(list=getItemAtIndex_187)
code_block_283 = CodeBlock(lijnlinks=flatten_173) { lijnlinks; }
distanceTo_8 = Geometry.DistanceTo(geometry=code_block_282, other=code_block_283)
round_5 = Math.Round(number=distanceTo_8)
sort_27 = List.Sort(list=round_5)
allIndicesOf_117 = List.AllIndicesOf(list=round_5, item=sort_27, lacing=Shortest)
flatten_174 = List.Flatten(list=allIndicesOf_117@L3)
uniqueItems_10 = List.UniqueItems(list=flatten_174@L2)
doesIntersect_42 = Geometry.DoesIntersect(geometry=code_block_283, other=code_block_282, lacing=Shortest)
countTrue_7 = List.CountTrue(list=doesIntersect_42@L2)
chop_52 = List.Chop(list=uniqueItems_10@L2, lengths=countTrue_7, lacing=Shortest)
sort_28 = List.Sort(list=chop_52@L3)
flatten_175 = List.Flatten(list=sort_28@L3)
getItemAtIndex_188 = List.GetItemAtIndex(list=code_block_282, index=flatten_175, lacing=Shortest)
chop_53 = List.Chop(list=getItemAtIndex_188, lengths=countTrue_7, lacing=Shortest)
getItemAtIndex_189 = List.GetItemAtIndex(list=transpose_36@L3, index=code_block_237.out2)
flatten_176 = List.Flatten(list=getItemAtIndex_189)
code_block_284 = CodeBlock(lijnenboven=flatten_176) { lijnenboven; }
distanceTo_9 = Geometry.DistanceTo(geometry=code_block_284, other=chop_53)
sort_29 = List.Sort(list=distanceTo_9)
allIndicesOf_118 = List.AllIndicesOf(list=distanceTo_9@L2, item=sort_29@L2, lacing=Shortest)
flatten_177 = List.Flatten(list=allIndicesOf_118@L3)
getItemAtIndex_190 = List.GetItemAtIndex(list=chop_53@L2, index=flatten_177@L2, lacing=Shortest)
count_44 = List.Count(list=chop_53@L3)
chop_54 = List.Chop(list=getItemAtIndex_190, lengths=count_44)
transpose_37 = List.Transpose(lists=chop_54@L3)
code_block_285 = CodeBlock(cellengeorganiseerd=transpose_37) { cellengeorganiseerd; }
flatten_178 = List.Flatten(list=transpose_37@L3)
flatten_179 = List.Flatten(list=flatten_178)
count_45 = List.Count(list=flatten_179)
cycle_29 = List.Cycle(list=code_block_238, amount=count_45)
getItemAtIndex_191 = List.GetItemAtIndex(list=transpose_36@L3, index=code_block_237.out3)
flatten_180 = List.Flatten(list=getItemAtIndex_191)
scale = Geometry.Scale(geometry=flatten_180, amount=code_block_240)
scale_2 = Geometry.Scale(geometry=flatten_178, amount=code_block_240)
perimeterCurves_23 = Surface.PerimeterCurves(surface=scale_2)
startPoint_38 = Curve.StartPoint(curve=perimeterCurves_23)
doesIntersect_43 = Geometry.DoesIntersect(geometry=scale, other=startPoint_38)
allTrue_14 = List.AllTrue(list=doesIntersect_43@L2)
allIndicesOf_119 = List.AllIndicesOf(list=allTrue_14, item=code_block_241)
getItemAtIndex_192 = List.GetItemAtIndex(list=flatten_179, index=allIndicesOf_119)
eq_50 = getItemAtIndex_192 == flatten_179  # lacing=CrossProduct
allIndicesOf_120 = List.AllIndicesOf(list=eq_50@L2, item=code_block_242)
flatten_181 = List.Flatten(list=allIndicesOf_120)
count_46 = List.Count(list=flatten_181)
cycle_30 = List.Cycle(list=code_block_239, amount=count_46)
python_script_6 = Python(IN[0]=cycle_29, IN[1]=cycle_30, IN[2]=flatten_181)  # IronPython2; same code as python_script
allIndicesOf_121 = List.AllIndicesOf(list=python_script_6, item=code_block_244)
count_47 = List.Count(list=allIndicesOf_121)
cycle_31 = List.Cycle(list=code_block_243, amount=count_47)
python_script_7 = Python(IN[0]=python_script_6, IN[1]=cycle_31, IN[2]=allIndicesOf_121)  # IronPython2; same code as python_script
allIndicesOf_122 = List.AllIndicesOf(list=python_script_7, item=code_block_246)
count_48 = List.Count(list=allIndicesOf_122)
cycle_32 = List.Cycle(list=code_block_245, amount=count_48)
python_script_8 = Python(IN[0]=python_script_7, IN[1]=cycle_32, IN[2]=allIndicesOf_122)  # IronPython2; same code as python_script
count_49 = List.Count(list=flatten_178@L2)
chop_55 = List.Chop(list=python_script_8, lengths=count_49)
doesIntersect_44 = Geometry.DoesIntersect(geometry=code_block_284, other=code_block_282, lacing=Shortest)
countTrue_8 = List.CountTrue(list=doesIntersect_44@L2)
chop_56 = List.Chop(list=chop_55@L2, lengths=countTrue_8, lacing=Shortest)
python_script_9 = Python(IN[0]=chop_56)  # CPython3
# ---------- python_script_9.python (23 lines) ----------
# Load the Python Standard and DesignScript Libraries
import sys
import clr
clr.AddReference('ProtoGeometry')
from Autodesk.DesignScript.Geometry import *
sys.path.append(r'C:\Users\donny\AppData\Local\Programs\Python\Python38\Lib\site-packages')
import largestinteriorrectangle as lir
import numpy as np

# The inputs to this node will be stored as a list in the IN variables.
coordinates1 = IN[0]

# Place your code below this line
listtest1=[]
for item in coordinates1:
    grid = np.array(item,
                    "bool")
    listtest1.append(lir.lir(grid))
    


# Assign your output to the OUT variable.
OUT = listtest1
# ----------------------------------------
chop_57 = List.Chop(list=python_script_9@L2, lengths=code_block_247)
getItemAtIndex_193 = List.GetItemAtIndex(list=chop_57@L3, index=code_block_248.out1)
flatten_182 = List.Flatten(list=getItemAtIndex_193)
string_from_object_10 = FromObject(object=flatten_182)
# note: rij
toNumber = String.ToNumber(string=string_from_object_10)
getItemAtIndex_194 = List.GetItemAtIndex(list=code_block_285, index=toNumber, lacing=Shortest)
getItemAtIndex_195 = List.GetItemAtIndex(list=chop_57@L3, index=code_block_248.out0)
flatten_183 = List.Flatten(list=getItemAtIndex_195)
string_from_object_11 = FromObject(object=flatten_183)
# note: Indice
toNumber_2 = String.ToNumber(string=string_from_object_11)
getItemAtIndex_196 = List.GetItemAtIndex(list=getItemAtIndex_194, index=toNumber_2, lacing=Shortest)
getItemAtIndex_197 = List.GetItemAtIndex(list=chop_57@L3, index=code_block_248.out3)
flatten_184 = List.Flatten(list=getItemAtIndex_197)
string_from_object_12 = FromObject(object=flatten_184)
toNumber_3 = String.ToNumber(string=string_from_object_12)
code_block_286 = CodeBlock(x=toNumber_3) { x-1; }
add = toNumber + code_block_286
getItemAtIndex_198 = List.GetItemAtIndex(list=code_block_285, index=add, lacing=Shortest)
getItemAtIndex_199 = List.GetItemAtIndex(list=chop_57@L3, index=code_block_248.out2)
flatten_185 = List.Flatten(list=getItemAtIndex_199)
string_from_object_13 = FromObject(object=flatten_185)
toNumber_4 = String.ToNumber(string=string_from_object_13)
code_block_287 = CodeBlock(x=toNumber_4) { x-1; }
add_2 = toNumber_2 + code_block_287
getItemAtIndex_200 = List.GetItemAtIndex(list=getItemAtIndex_198, index=add_2, lacing=Shortest)
list_create_47 = List.Create(item0=getItemAtIndex_196, item1=getItemAtIndex_200)
transpose_38 = List.Transpose(lists=list_create_47)
chop_58 = List.Chop(list=transpose_38, lengths=count_32)
code_block_288 = CodeBlock(fromcoordinatesystem=coordinateSystemAtParameter_2) { fromcoordinatesystem; }
code_block_289 = CodeBlock(contextcoordinatesystem=transpose_22) { contextcoordinatesystem; }
transform_5 = Geometry.Transform(geometry=chop_58, fromCoordinateSystem=code_block_288, contextCoordinateSystem=code_block_289, lacing=Shortest)
byGeometry_3 = BoundingBox.ByGeometry(geom=transform_5, lacing=Longest)
flatten_186 = List.Flatten(list=byGeometry_3)
code_block_290 = CodeBlock(bb=flatten_186, z=code_block_249)  # same code as code_block_136
flatten_187 = List.Flatten(list=code_block_289)
flatten_188 = List.Flatten(list=code_block_288)
transform_6 = Geometry.Transform(geometry=code_block_290.r1, fromCoordinateSystem=flatten_187, contextCoordinateSystem=flatten_188)
chop_59 = List.Chop(list=transform_6, lengths=count_32)
byPatch_9 = Surface.ByPatch(closedCurve=chop_59)
area_7 = Surface.Area(surface=byPatch_9)
sort_30 = List.Sort(list=area_7)
lastItem_18 = List.LastItem(list=sort_30@L2)
indexOf_16 = List.IndexOf(list=area_7@L2, element=lastItem_18@L1, lacing=Shortest)
getItemAtIndex_201 = List.GetItemAtIndex(list=byPatch_9, index=indexOf_16, lacing=Shortest)
geometrySplit_6 = Geometry.Intersection.GeometrySplit(geometry=code_block_267, cutting=getItemAtIndex_201)
flatten_189 = List.Flatten(list=geometrySplit_6)
perimeterCurves_24 = Surface.PerimeterCurves(surface=flatten_189)
count_50 = List.Count(list=perimeterCurves_24@L2)
eq_51 = count_50 == code_block_250
allIndicesOf_123 = List.AllIndicesOf(list=eq_51, item=code_block_251)
removeItemAtIndex_51 = List.RemoveItemAtIndex(list=flatten_189, indices=allIndicesOf_123)
getItemAtIndex_202 = List.GetItemAtIndex(list=flatten_189, index=allIndicesOf_123)
code_block_291 = CodeBlock(surfaces=getItemAtIndex_202) { surfaces; }
perimeterCurves_25 = Surface.PerimeterCurves(surface=code_block_291)
flatten_190 = List.Flatten(list=perimeterCurves_25)
startPoint_39 = Curve.StartPoint(curve=perimeterCurves_25)
flatten_191 = List.Flatten(list=startPoint_39)
doesIntersect_45 = Geometry.DoesIntersect(geometry=flatten_191, other=flatten_190, lacing=CrossProduct)
allIndicesOf_124 = List.AllIndicesOf(list=doesIntersect_45@L2, item=code_block_252)
getItemAtIndex_203 = List.GetItemAtIndex(list=flatten_190, index=allIndicesOf_124)
direction_3 = Line.Direction(line=getItemAtIndex_203)
firstItem_20 = List.FirstItem(list=direction_3@L2)
lastItem_19 = List.LastItem(list=direction_3@L2)
angleAboutAxis_3 = Vector.AngleAboutAxis(vector=firstItem_20, otherVector=lastItem_19, rotationAxis=ZAxis_3)
ge_12 = angleAboutAxis_3 >= code_block_253
allIndicesOf_125 = List.AllIndicesOf(list=ge_12, item=code_block_254)
getItemAtIndex_204 = List.GetItemAtIndex(list=angleAboutAxis_3, index=allIndicesOf_125)
code_block_292 = CodeBlock(x=getItemAtIndex_204) { 360-x; }
python_script_10 = Python(IN[0]=angleAboutAxis_3, IN[1]=code_block_292, IN[2]=allIndicesOf_125)  # IronPython2; same code as python_script
count_51 = List.Count(list=startPoint_39@L2)
chop_60 = List.Chop(list=python_script_10, lengths=count_51)
round_6 = Math.Round(number=chop_60)
eq_52 = round_6 == code_block_255
allTrue_15 = List.AllTrue(list=eq_52@L2)
allIndicesOf_126 = List.AllIndicesOf(list=allTrue_15, item=code_block_256)
removeItemAtIndex_52 = List.RemoveItemAtIndex(list=code_block_291, indices=allIndicesOf_126)
getItemAtIndex_205 = List.GetItemAtIndex(list=code_block_291, index=allIndicesOf_126)
code_block_293 = CodeBlock(oppervlakten=getItemAtIndex_205) { oppervlakten; }
perimeterCurves_26 = Surface.PerimeterCurves(surface=code_block_293)
length_28 = Curve.Length(curve=perimeterCurves_26)
sort_31 = List.Sort(list=length_28)
firstItem_21 = List.FirstItem(list=sort_31@L2)
round_7 = Math.Round(number=firstItem_21)
lt = round_7 < sub
code_block_294 = CodeBlock { true; }
allIndicesOf_127 = List.AllIndicesOf(list=lt, item=code_block_294)
getItemAtIndex_206 = List.GetItemAtIndex(list=code_block_293, index=allIndicesOf_127)
list_create_48 = List.Create(item0=getItemAtIndex_170, item1=byPatch_4, item2=getItemAtIndex_182, item3=removeItemAtIndex_51, item4=removeItemAtIndex_52, item5=getItemAtIndex_206)
flatten_192 = List.Flatten(list=list_create_48)
code_block_295 = CodeBlock { 78; 129; 0; }
byARGB_2 = Color.ByARGB(red=code_block_295.out0, green=code_block_295.out1, blue=code_block_295.out2)
byGeometryColor_2 = Modifiers.GeometryColor.ByGeometryColor(geometry=flatten_192, color=byARGB_2)
getItemAtIndex_207 = List.GetItemAtIndex(list=code_block_262, index=allIndicesOf_105)
getItemAtIndex_208 = List.GetItemAtIndex(list=flatten_126, index=allIndicesOf_108)
list_create_49 = List.Create(item0=getItemAtIndex_207, item1=getItemAtIndex_208)
flatten_193 = List.Flatten(list=list_create_49)
code_block_296 = CodeBlock(allerechthoeken=flatten_193) { allerechthoeken; }
removeItemAtIndex_53 = List.RemoveItemAtIndex(list=code_block_293, indices=allIndicesOf_127)
list_create_50 = List.Create(item0=code_block_296, item1=removeItemAtIndex_53)
perimeterCurves_27 = Surface.PerimeterCurves(surface=list_create_50)
flatten_194 = List.Flatten(list=chop_56)
sum_3 = Math.Sum(values=flatten_194)
test_BR_001 = Watch(sum_3)  # graph output
flatten_195 = List.Flatten(list=python_script_9)
string_from_object_14 = FromObject(object=flatten_195)
toNumber_5 = String.ToNumber(string=string_from_object_14)
sum_4 = Math.Sum(values=toNumber_5)
test_BR_002 = Watch(sum_4)  # graph output
flatten_196 = List.Flatten(list=join_2)
count_52 = List.Count(list=flatten_196)
testpunt_001 = Watch(count_52)  # graph output
flatten_197 = List.Flatten(list=getItemAtIndex_4)
count_53 = List.Count(list=flatten_197)
testpunt_002 = Watch(count_53)  # graph output
flatten_198 = List.Flatten(list=code_block_68)
count_54 = List.Count(list=flatten_198)
testpunt_003 = Watch(count_54)  # graph output
flatten_199 = List.Flatten(list=code_block_91.kavels)
count_55 = List.Count(list=flatten_199)
testpunt_004 = Watch(count_55)  # graph output
flatten_200 = List.Flatten(list=area_2)
count_56 = List.Count(list=flatten_200)
testpunt_005 = Watch(count_56)  # graph output
flatten_201 = List.Flatten(list=remember)
count_57 = List.Count(list=flatten_201)
testpunt_006 = Watch(count_57)  # graph output
flatten_202 = List.Flatten(list=remember_2)
count_58 = List.Count(list=flatten_202)
testpunt_007 = Watch(count_58)  # graph output
