# Dynamo graph ColorRangeInvalidInputCrash.dyn (Dynamo 0.8.1.1314)

change_this_to_number = CodeBlock { green = Color.ByARGB(255, 0, 255, 0); }
code_block = CodeBlock { 255; indices = 0.5; value = 0.5; }
byARGB = Color.ByARGB(b=code_block.out0)
code_block_2 = CodeBlock(color1=change_this_to_number, color2=byARGB) { { color1, color2 }; }
color_range = ColorRange(code_block_2, code_block.indices, code_block.value)
