# Dynamo graph ConnectorShowHideAllWires.dyn (Dynamo 2.16.0.1640)

code_block = CodeBlock { x; }  # unwired: x
code_block_2 = CodeBlock(x=code_block) { x; }
code_block_3 = CodeBlock { x; }  # unwired: x
code_block_4 = CodeBlock(x=code_block_3) { x; }
code_block_5 = CodeBlock { x; }  # unwired: x
code_block_6 = CodeBlock(x=code_block_5) { x; }
code_block_7 = CodeBlock { x; }  # unwired: x
code_block_8 = CodeBlock(x=code_block_7) { x; }
