# Dynamo graph GraphWithPIIData.dyn (Dynamo 3.0.0.6555)
# Jesus

# note: These are my credit cards :  3141-5926-5358-9793, 5358,3141,5926,1791 and 4558 6255 1254 3670
# note: These are my SSNs :  123-45-6789 and 123 45 6789
string = StringInput("C:\Users\alvinoj\OneDrive - 638273137349440213 - Autodesk\Desktop\simpleTextFile.txt")
file_from_path = FileObject(path=string)
watch = Watch(file_from_path)
file_path = Filename("..\Globant\Tarjeta Globant TEBCA-.txt")
# note: I'am a note created by jesus.alfredo.alvino@autodesk.com
# note: Date 1 : 01/01/1984
python_script = Python()  # CPython3; unwired: IN[0]; starter script, not edited (OUT = 0)
string_2 = StringInput("This is my Ip address : 192.168.10.150 ")
string_3 = StringInput("""My favorites dates :

01/17/2025
12/12/2024
10-10-2024
01/01/23
02/02/2024
12/13/25


""")
