# Dynamo graph InvalidValueShouldNotCrashColorRangeNode.dyn (Dynamo 0.8.1.1314)

code_block = CodeBlock()
# ---------- code_block.designscript (6 lines) ----------
{
    Color.ByARGB(255, 0, 255, 128),
    Color.ByARGB(255, 0, 128, 255)
};

{ "Value that can't be converted to double", 0.68 };
# ----------------------------------------
color_range = ColorRange(code_block.out0, code_block.out1, code_block.out1)
code_block_2 = CodeBlock()
# ---------- code_block_2.designscript (6 lines) ----------
{
    Color.ByARGB(255, 0, 255, 128),
    Color.ByARGB(255, 0, 128, 255)
};

"Value that can't be converted to double";
# ----------------------------------------
color_range_2 = ColorRange(code_block_2.out0, code_block_2.out1, code_block_2.out1)
