# Dynamo graph NodeWarningBarColorTest.dyn (Dynamo 2.13.0.3447)

code_block = CodeBlock { "Warning Bar Warning"; a = b; b = a; }
code_block_2 = CodeBlock { Warning Bar Error"; }
code_block_3 = CodeBlock { "Warning Bar Preview Off"; }
code_block_4 = CodeBlock { "No Waring Bar"; }
