# Dynamo graph UIColorRange.dyn (Dynamo 0.8.1.1046)

watch = Watch()
code_block = CodeBlock { a=Color.ByARGB(255,0,0,255); b=Color.ByARGB(255,255,0,0); colors={a,b}; indices={0,1}; 1; }
color_range = ColorRange(code_block.b, code_block.indices, code_block.out4)
watch_2 = Watch(color_range)
