# Dynamo graph UIColorRange2.dyn (Dynamo 0.8.1.995)

code_block = CodeBlock { a=Color.ByARGB(255,255,0,0); 3; 2; }
color_range = ColorRange(code_block.a, code_block.out1, code_block.out2)
watch = Watch(color_range)
