# Dynamo graph UIGateNode.dyn (Dynamo 3.0.0.5795)

code_block = CodeBlock { 1; }
gate = Gate(false, code_block)
isNull = Object.IsNull(object=gate)
gate_2 = Gate(true, code_block)
isNull_2 = Object.IsNull(object=gate_2)
