# Dynamo graph UI_visual_test.dyn (Dynamo 0.7.0.10491)

# note: Watch nodes should show lists as unfolded by default, and should not get excessively long or wide.
number = DoubleInput(0..100)
watch = Watch(number)
code_block = CodeBlock { Point.ByCoordinates((0..3)<1>,(0..3)<2>,(0..3)<3>); }
# note: Watch nodes should be resizable without affecting sizing of other UI elements on the node.
watch_3d = Watch3D(code_block)
file_path = Filename("C:\Users\Ian\Documents\Dynamo\test\UI\Bricks.PNG")
loadImageFromPath = File.LoadImageFromPath(file_path)
# note: Images should load in the presentation grid on the node.
watch_image = WatchImageCore(loadImageFromPath)
watch_3d_2 = Watch3D(code_block)
# note: •Double and Integer sliders should show the correct numerical precision.
# •Integer sliders should show ticks.
double_slider = DoubleSlider(49.608, range=0..100)
integer_slider = IntegerSlider(14, range=0..25)
# note: Special characters in a string should display the same in the watch window.
string = StringInput("""This is a long string with some carriage returns...


And some special characters...
§¾¶©ﺊﷺ""")
watch_2 = Watch(string)
create_list = List.Create()
# note: Boolean nodes should toggle correctly and their watch values should read "True" and "False"
boolean = BoolSelector(false)
watch_3 = Watch(boolean)
boolean_2 = BoolSelector(true)
watch_4 = Watch(boolean_2)
byPoints = NurbsCurve.ByPoints(code_block)
watch_5 = Watch(byPoints)
watch_3d_3 = Watch3D(watch_5)
number_2 = DoubleInput(21)
string_2 = StringInput("hello")
# note: •Long port names should have ellipsis.
# •Input and output port collections should be aligned.
code_block_2 = CodeBlock(foo=number_2, AReallyLongPortNameThatShouldBeShortened=string_2) { a = foo; b = AReallyLongPortNameThatShouldBeShortened; foo = 42; }
watch_6 = Watch(code_block_2.foo)
watch_7 = Watch(code_block_2.b)
watch_8 = Watch(code_block_2.a)
# note: This node should error and turn red.
code_block_3 = CodeBlock { error=; }
# note: This node should error and turn yellow.
code_block_4 = CodeBlock { Point.ByBlah(0,0,0); }
number_3 = DoubleInput(42)
# note: Unit types should show their suffix in watch windows when the watch window's "Show Raw Data" is turned off.
fromDouble = DynamoUnits.Length.FromDouble(number_3)
watch_9 = Watch(fromDouble)
fromDouble_2 = DynamoUnits.Area.FromDouble(number_3)
watch_10 = Watch(fromDouble_2)
fromDouble_3 = DynamoUnits.Volume.FromDouble(number_3)
watch_11 = Watch(fromDouble_3)
# note: A coodinate system should draw as red, green, and blue axes.
identity = CoordinateSystem.Identity()
watch_3d_4 = Watch3D(identity)
