# Dynamo graph VariableInputNodes.dyn (Dynamo 0.7.6.3900)

code_block = CodeBlock { " "; }
code_block_2 = CodeBlock { "dynamo"; }
code_block_3 = CodeBlock { "bim"; }
join = String.Join(code_block, code_block_2, code_block_3)
concat = String.Concat(code_block_2, code_block_3)
code_block_4 = CodeBlock { {1,2,3}; }
code_block_5 = CodeBlock { {4,5}; }
join_2 = List.Join(code_block_4, code_block_5)
