# Dynamo graph WatchNodePlacement.dyn (Dynamo 2.13.0.2974)

code_block = CodeBlock { test1; test2; test3; test4; }  # unwired: test1, test2, test3, test4
code_block_2 = CodeBlock(a=code_block.test1, b=code_block.test2, c=code_block.test3, d=code_block.test4) { a; b; c; d; }
code_block_3 = CodeBlock(a=code_block.test1, b=code_block.test2, c=code_block.test3, d=code_block.test4) { a; b; c; d; }
