# Dynamo graph WatchUINodes.dyn (Dynamo 0.7.5.3365)

code_block = CodeBlock { {1,2,3}; }
watch = Watch(code_block)
code_block_2 = CodeBlock { Point.ByCoordinates(0,0); }
watch_3d = Watch3D(code_block_2)
file_path = Filename("X:\Dynamo-pboyer\Dynamo\test\UI\Bricks.PNG")
fromPath = FileObject(file_path)  # "File.FromPath"
readFromFile = Image.ReadFromFile(fromPath)
watch_image = WatchImageCore(readFromFile)
