# Dynamo custom node built_in_custom_geo_node.dyf "cusTest" (Dynamo 2.12.0.4836)
# category: testCat

geo = Input(geo: Autodesk.DesignScript.Geometry.Geometry)
boundingBox = Geometry.BoundingBox(geometry=geo)
BoundingBox = Output(boundingBox)
color = Input(color: DSCore.Color)
add = Color.Add(color=color, otherColor=color)
Color = Output(add)
