# Dynamo graph color_range_ports.dyn (Dynamo 2.15.0.4946)

code_block = CodeBlock { 12; }
color_range = ColorRange(value=code_block)  # unwired: colors, indices
python_script = Python()  # CPython3; unwired: IN[0]; starter script, not edited (OUT = 0)
