# Dynamo graph errorbubbleperf.dyn (Dynamo 2.14.0.3430)

code_block = CodeBlock()
# ---------- code_block.designscript (3 lines) ----------
def add(x:double,y:double)
{return x + y;
};
# ----------------------------------------
inputnode = CodeBlock { "a"; }
code_block_2 = CodeBlock(x=inputnode, y=inputnode) { add(x,y); }
code_block_3 = CodeBlock(x=inputnode, y=inputnode) { add(x,y); }
code_block_4 = CodeBlock(x=inputnode, y=inputnode) { add(x,y); }
code_block_5 = CodeBlock(x=inputnode, y=inputnode) { add(x,y); }
code_block_6 = CodeBlock(x=inputnode, y=inputnode) { add(x,y); }
code_block_7 = CodeBlock(x=inputnode, y=inputnode) { add(x,y); }
code_block_8 = CodeBlock(x=inputnode, y=inputnode) { add(x,y); }
code_block_9 = CodeBlock(x=inputnode, y=inputnode) { add(x,y); }
code_block_10 = CodeBlock(x=inputnode, y=inputnode) { add(x,y); }
code_block_11 = CodeBlock(x=inputnode, y=inputnode) { add(x,y); }
code_block_12 = CodeBlock(x=inputnode, y=inputnode) { add(x,y); }
code_block_13 = CodeBlock(x=inputnode, y=inputnode) { add(x,y); }
code_block_14 = CodeBlock(x=inputnode, y=inputnode) { add(x,y); }
code_block_15 = CodeBlock(x=inputnode, y=inputnode) { add(x,y); }
code_block_16 = CodeBlock(x=inputnode, y=inputnode) { add(x,y); }
code_block_17 = CodeBlock(x=inputnode, y=inputnode) { add(x,y); }
code_block_18 = CodeBlock(x=inputnode, y=inputnode) { add(x,y); }
code_block_19 = CodeBlock(x=inputnode, y=inputnode) { add(x,y); }
code_block_20 = CodeBlock(x=inputnode, y=inputnode) { add(x,y); }
code_block_21 = CodeBlock(x=inputnode, y=inputnode) { add(x,y); }
code_block_22 = CodeBlock(x=inputnode, y=inputnode) { add(x,y); }
code_block_23 = CodeBlock(x=inputnode, y=inputnode) { add(x,y); }
code_block_24 = CodeBlock(x=inputnode, y=inputnode) { add(x,y); }
code_block_25 = CodeBlock(x=inputnode, y=inputnode) { add(x,y); }
code_block_26 = CodeBlock(x=inputnode, y=inputnode) { add(x,y); }
code_block_27 = CodeBlock(x=inputnode, y=inputnode) { add(x,y); }
code_block_28 = CodeBlock(x=inputnode, y=inputnode) { add(x,y); }
code_block_29 = CodeBlock(x=inputnode, y=inputnode) { add(x,y); }
code_block_30 = CodeBlock(x=inputnode, y=inputnode) { add(x,y); }
code_block_31 = CodeBlock(x=inputnode, y=inputnode) { add(x,y); }
code_block_32 = CodeBlock(x=inputnode, y=inputnode) { add(x,y); }
code_block_33 = CodeBlock(x=inputnode, y=inputnode) { add(x,y); }
code_block_34 = CodeBlock(x=inputnode, y=inputnode) { add(x,y); }
code_block_35 = CodeBlock(x=inputnode, y=inputnode) { add(x,y); }
code_block_36 = CodeBlock(x=inputnode, y=inputnode) { add(x,y); }
code_block_37 = CodeBlock(x=inputnode, y=inputnode) { add(x,y); }
code_block_38 = CodeBlock(x=inputnode, y=inputnode) { add(x,y); }
code_block_39 = CodeBlock(x=inputnode, y=inputnode) { add(x,y); }
code_block_40 = CodeBlock(x=inputnode, y=inputnode) { add(x,y); }
code_block_41 = CodeBlock(x=inputnode, y=inputnode) { add(x,y); }
code_block_42 = CodeBlock(x=inputnode, y=inputnode) { add(x,y); }
code_block_43 = CodeBlock(x=inputnode, y=inputnode) { add(x,y); }
code_block_44 = CodeBlock(x=inputnode, y=inputnode) { add(x,y); }
code_block_45 = CodeBlock(x=inputnode, y=inputnode) { add(x,y); }
code_block_46 = CodeBlock(x=inputnode, y=inputnode) { add(x,y); }
code_block_47 = CodeBlock(x=inputnode, y=inputnode) { add(x,y); }
code_block_48 = CodeBlock(x=inputnode, y=inputnode) { add(x,y); }
code_block_49 = CodeBlock(x=inputnode, y=inputnode) { add(x,y); }
code_block_50 = CodeBlock(x=inputnode, y=inputnode) { add(x,y); }
code_block_51 = CodeBlock(x=inputnode, y=inputnode) { add(x,y); }
code_block_52 = CodeBlock(x=inputnode, y=inputnode) { add(x,y); }
code_block_53 = CodeBlock(x=inputnode, y=inputnode) { add(x,y); }
code_block_54 = CodeBlock(x=inputnode, y=inputnode) { add(x,y); }
code_block_55 = CodeBlock(x=inputnode, y=inputnode) { add(x,y); }
code_block_56 = CodeBlock(x=inputnode, y=inputnode) { add(x,y); }
code_block_57 = CodeBlock(x=inputnode, y=inputnode) { add(x,y); }
code_block_58 = CodeBlock(x=inputnode, y=inputnode) { add(x,y); }
code_block_59 = CodeBlock(x=inputnode, y=inputnode) { add(x,y); }
code_block_60 = CodeBlock(x=inputnode, y=inputnode) { add(x,y); }
code_block_61 = CodeBlock(x=inputnode, y=inputnode) { add(x,y); }
code_block_62 = CodeBlock(x=inputnode, y=inputnode) { add(x,y); }
code_block_63 = CodeBlock(x=inputnode, y=inputnode) { add(x,y); }
code_block_64 = CodeBlock(x=inputnode, y=inputnode) { add(x,y); }
code_block_65 = CodeBlock(x=inputnode, y=inputnode) { add(x,y); }
