# Dynamo graph keepListStructure.dyn (Dynamo 2.1.0.6876)

code_block = CodeBlock { [[[0]],[1,2,3,4]]; }
code_block_2 = CodeBlock { ["a","b","c"]; }
add = code_block@L2 + code_block_2
rank = List.Rank(list=add)
