# Dynamo graph outport_valuemarker_portDefaultValueMarkerVisible.dyn (Dynamo 2.16.0.2215)

with_function_state = DesignScript.Builtin.Dictionary.ByKeysValues()  # unwired: keys, values
code_block = CodeBlock { ["Hello","World"]; [1,2]; }
no_function_state = DesignScript.Builtin.Dictionary.ByKeysValues(keys=code_block.out0, values=code_block.out1)
