# Dynamo graph BooleanCoercion.dyn (Dynamo 2.14.0.3430)

code_block = CodeBlock()
# ---------- code_block.designscript (6 lines) ----------
a : Point = null;
def foo(x : bool)
{
    return x;
}
x = foo(a);
# ----------------------------------------
code_block_2 = CodeBlock()
# ---------- code_block_2.designscript (11 lines) ----------
i = [Imperative]
{
	if("")
	{
		return true;
	}
	else
	{
		return false;
	}
};
# ----------------------------------------
