# Dynamo graph case_flip_matrix.dyn (Dynamo 1.0.1.1743)

number = DoubleInput(0)
number_2 = DoubleInput(10)
number_3 = DoubleInput(1)
range = Range(start=number, end=number_2, step=number_3, lacing=Longest)
number_4 = DoubleInput(0)
number_5 = DoubleInput(10)
range_2 = Range(start=number_4, end=number_5, step=number_3, lacing=Longest)
create_list = List.Create(range, range_2)
watch = Watch(create_list)
case_flip_list_matrix = Custom[CASE Flip List Matrix](List_of_Lists=create_list)
watch_2 = Watch(case_flip_list_matrix)
