# Dynamo graph ConvertBetweenUnitsTest.dyn (Dynamo 0.8.0.781)

number = DoubleInput(10)
convert_between_units = DynamoConvert(number, conversionMetric=Length, conversionFrom=Meters, conversionTo=Millimeters)
watch = Watch(convert_between_units)
