# Dynamo custom node CNDefault.dyf (Dynamo 2.0.0.4501)
# category: Core
# Testing Custom Node Default Value Serialization

center = Input(center: Point = Point.ByCoordinates(10,10,10))
radius = Input(radius: double = 5.5)
code_block = CodeBlock(center=center, radius=radius) { Sphere.ByCenterPointRadius(center, radius); }
Output = Output(code_block)  # ""
