# Dynamo custom node CNDefault_json.dyf "CNDefault" (Dynamo 2.0.0.2486)
# Testing Custom Node Default Value Serialization

center = Input(center: Autodesk.DesignScript.Geometry.Point = Autodesk.DesignScript.Geometry.Point.ByCoordinates(10, 10, 10))
radius = Input(radius: double = 5.5)
code_block = CodeBlock(center=center, radius=radius) { Sphere.ByCenterPointRadius(center, radius); }
Output = Output(code_block)  # ""
