# Dynamo custom node Centroid.dyf (Dynamo 1.0.1.1743)
# category: CustomNodetesting

polygon = Input()
points = Polygon.Points(polygon)
code_block = CodeBlock(polyvertex=points)
# ---------- code_block.designscript (3 lines) ----------
cen=polyvertex;
cenln1=Line.ByStartPointEndPoint(polyvertex[0],polyvertex[2]);
cenln2=Line.ByStartPointEndPoint(polyvertex[1],polyvertex[3]);
# ----------------------------------------
intersect = Geometry.Intersect(geometry=code_block.cenln1, other=code_block.cenln2)
cen = Output(intersect)
