# Dynamo custom node OuterCustomNode.dyf (Dynamo 1.0.1.1740)
# category: Test.OuterNodes

code_block = CodeBlock { {1,2,3,4}; }
Y = Input()
innerCiustomNode = Custom[InnerCiustomNode](Y=Y)
map = List.Map(list=code_block, f_x=innerCiustomNode)
mapped = Output(map)
