# Dynamo custom node QNTM3872_InputNodesUnknownTypes.dyf "DateTime.IsEarlier" (Dynamo 2.0.1.4534)
# category: Determines if a given date and time are earlier than another given date and time.
# Determines if a given date and time are earlier than another given date and time.

var1 = Input(var1: System.DateTime)
var2 = Input(var2: xxx.yyy)
python_script = Python(IN[0]=var1, IN[1]=var2)
# ---------- python_script.python (13 lines) ----------
import clr

def isEarlier(date1, date2):
	return date1 < date2

dates1 = IN[0]
dates2 = IN[1]

if not dates1 or not dates2: OUT = None
elif isinstance(dates1, list) and isinstance(dates2, list): OUT = [isEarlier(x, y) for x,y in zip(dates1, dates2)]
elif isinstance(dates1, list): OUT = [isEarlier(x, dates2) for x in dates1]
elif isinstance(dates2, list): OUT = [isEarlier(dates1, x) for x in dates2]
else: OUT = isEarlier(dates1, dates2)
# ----------------------------------------
bool = Output(python_script)
