# Dynamo graph TestAdd.dyn (Dynamo 1.0.0.1180)

integer_slider = IntegerSlider(1, range=0..100 step 1)
integer_slider_2 = IntegerSlider(1, range=0..100 step 1)
add = Custom[add](x=integer_slider, y=integer_slider_2)
