# Dynamo graph TestCentroid.dyn (Dynamo 0.7.1.25424)

code_block = CodeBlock { 1; }
code_block_2 = CodeBlock { 1; }
code_block_3 = CodeBlock { 0; }
byCoordinates = Point.ByCoordinates(code_block, code_block_2, code_block_3)
code_block_4 = CodeBlock { 10; }
byCoordinates_2 = Point.ByCoordinates(code_block_4, code_block_2, code_block_3)
code_block_5 = CodeBlock { 10; }
code_block_6 = CodeBlock { 5; }
code_block_7 = CodeBlock { 0; }
byCoordinates_3 = Point.ByCoordinates(code_block_5, code_block_6, code_block_7)
code_block_8 = CodeBlock { 1; }
byCoordinates_4 = Point.ByCoordinates(code_block_8, code_block_6, code_block_7)
code_block_9 = CodeBlock(a=byCoordinates, b=byCoordinates_2, c=byCoordinates_3, d=byCoordinates_4) { {a,b,c,d}; }
byPoints = Polygon.ByPoints(code_block_9)
centroid = Custom[Centroid](polygon=byPoints)
code_block_10 = CodeBlock(pt=centroid) { pt; x=pt[0].X; y=pt[0].Y; z=pt[0].Z; }
watch = Watch(code_block_10.x)
watch_2 = Watch(code_block_10.y)
watch_3 = Watch(code_block_10.z)
