# Dynamo graph TestConditional.dyn (Dynamo 0.7.0.41158)

code_block = CodeBlock { -1; }
testconditional = Custom[testconditional](a=code_block)
code_block_2 = CodeBlock(test1=testconditional) { test1; }
code_block_3 = CodeBlock { 1; }
testconditional_2 = Custom[testconditional](a=code_block_3)
code_block_4 = CodeBlock(test2=testconditional_2) { test2; }
