# Dynamo graph TestLacing.dyn (Dynamo 0.7.6.3485)

code_block = CodeBlock { 1..2; }
code_block_2 = CodeBlock { 3..4; }
add = Custom[add](x=code_block, y=code_block_2, lacing=CrossProduct)
watch = Watch(add)
