# Dynamo custom node TrussFrom4Points.dyf (Dynamo 0.7.2.26219)
# category: ComputationForum
# Creates a truss from 4 points, points must be ordered 1,2,3,4. right left top down

n4points = Input(4points)
testnode = Custom[testnode]()  # testcustomnode nest
map = List.Map(n4points, testnode)
asdasdasd = Output(map)
