# Dynamo custom node inputNodesWithComments.dyf "testing comment s7" (Dynamo 2.0.1.4885)
# category: misc
# testing comment 7

inputName = Input(inputName: string = "a def string")  # commentsssss
watch = Watch(inputName)
output = Output(watch)
