# Dynamo custom node invalidInputName.dyf (Dynamo 2.2.0.3785)
# category: Math

name_with_spaces = Input(name with spaces: var[]..[])
code_block = CodeBlock(x=name_with_spaces) { x + 5; }
Output = Output(code_block)  # ""
