# Dynamo graph missing_custom_node.dyn (Dynamo 0.7.5.3293)

code_block = CodeBlock { 1; }
code_block_2 = CodeBlock { 2; }
testcustom = Custom[testcustom](code_block, code_block_2)
testcustom_2 = Custom[testcustom](code_block)
