# Dynamo graph DelayedGraphExecution.dyn "20201022 dynamo exception" (Dynamo 2.8.0.2471)

flip_path_curve = BoolSelector(true)  # graph input
origin = Point.Origin()
XAxis = Vector.XAxis()
code_block = CodeBlock { 200; }
byStartPointDirectionLength = Line.ByStartPointDirectionLength(startPoint=origin, direction=XAxis, length=code_block)

# group: join the path curves
byJoinedCurves = PolyCurve.ByJoinedCurves(curves=byStartPointDirectionLength)

reverse = Curve.Reverse(curve=byJoinedCurves)
if_ = If(test=flip_path_curve, true=reverse, false=byJoinedCurves)
startPoint = Curve.StartPoint(curve=if_)
endPoint = Curve.EndPoint(curve=if_)

# group: overall line across endpoints of path
byStartPointEndPoint = Line.ByStartPointEndPoint(startPoint=startPoint, endPoint=endPoint)

# group: transverse vector along overall path curve
normalAtParameter = Curve.NormalAtParameter(curve=byStartPointEndPoint)
reverse_2 = Vector.Reverse(vector=normalAtParameter)
code_block_2 = CodeBlock { 0.5; }

initial_planter_row_offset_from = DoubleSlider(0, range=0..100 step 0.1)  # "Initial Planter Row Offset from Building"; graph input

# group: move initial curve out
translate = Geometry.Translate(geometry=if_, direction=reverse_2, distance=initial_planter_row_offset_from, lacing=CrossProduct)

# group: reversed path
reverse_3 = Curve.Reverse(curve=translate)

max_planter_coverage_along_path = DoubleSlider(1000, range=70..1000 step 0.1)  # graph input

# group: length of original path
length = Curve.Length(curve=byJoinedCurves)

code_block_3 = CodeBlock(x=max_planter_coverage_along_path, y=length) { x / y; }
code_block_4 = CodeBlock { 1; }
gt = code_block_3 > code_block_4
code_block_5 = CodeBlock { 1; }

# group: if greater than 1, just use 1
if_2 = If(test=gt, true=code_block_5, false=code_block_3)

splitByParameter = Curve.SplitByParameter(curve=reverse_3, parameters=if_2)
code_block_6 = CodeBlock { 0; }

# group: get only a portion of the curve
getItemAtIndex = List.GetItemAtIndex(list=splitByParameter, index=code_block_6)

extended_coverage_one_side = DoubleSlider(0, range=0..500 step 0.1)

# group: extend trimmed portion
extendStart = Curve.ExtendStart(curve=getItemAtIndex, distance=extended_coverage_one_side)

code_block_7 = CodeBlock { 0; }
planter_length = DoubleSlider(20, range=2..500 step 0.1)  # graph input
planter_longitudinal_spacing = DoubleSlider(8, range=6..500 step 0.1)  # graph input

# group: typical planter and spacing pattern
list_create = List.Create(item0=planter_length, item1=planter_longitudinal_spacing)

# group: create an alternating sequence
code_block_8 = CodeBlock(start=code_block_7, end=max_planter_coverage_along_path, list=list_create)
# ---------- code_block_8.designscript (23 lines) ----------
def sequenceByList(start: double, end: double, valList:var[])
 {
    vals = [start];
    end;
    x = vals[0];
    list = valList;
    is = [];
    out = [Imperative]
    {
        i = 0;
while (x < end)
        {
            is = DSCore.List.Flatten([is,i]);
            add = vals[-1]+DSCore.List.ShiftIndices(list,(-i))[0];
            i = i+1;
            vals = DSCore.List.Join([vals,add]);
            x = vals[-1];
        };
return = [is,vals];
    };
return = DSCore.List.Clean(out[1] <= end ? out[1] : null, false);
 };
sequenceByList(start,end,list);
# ----------------------------------------

length_2 = Curve.Length(curve=extendStart)

# group: convert to params
code_block_9 = CodeBlock(x=code_block_8, y=length_2) { x / y; }

# group: get only the parameters less than 1
code_block_10 = CodeBlock { 1; }
lt = code_block_9 < code_block_10
filterByBoolMask = List.FilterByBoolMask(list=code_block_9, mask=lt)

splitByParameter_2 = Curve.SplitByParameter(curve=extendStart, parameters=filterByBoolMask.in)
code_block_11 = CodeBlock { 2; }
code_block_12 = CodeBlock { 0; }

# group: get every other segment
dropEveryNthItem = List.DropEveryNthItem(list=splitByParameter_2, n=code_block_11, offset=code_block_12)

# group: rebuild the selected segments
approximateWithArcAndLineSegments = Curve.ApproximateWithArcAndLineSegments(curve=dropEveryNthItem)
byJoinedCurves_2 = PolyCurve.ByJoinedCurves(curves=approximateWithArcAndLineSegments)

planter_width = DoubleSlider(3, range=3..500 step 0.1)  # graph input
planter_transverse_spacing = DoubleSlider(10, range=7.5..500 step 0.1)  # graph input

# group: transverse spacing plus planter width
add = planter_width + planter_transverse_spacing

code_block_13 = CodeBlock(x=add) { x*2; }
max_planter_coverage_transverse = DoubleSlider(5, range=5..500 step 0.1)  # graph input
sub = max_planter_coverage_transverse - initial_planter_row_offset_from

# group: transverse sequence
code_block_14 = CodeBlock(x=sub, y=code_block_13) { x/y; }
sequence = Sequence(start=code_block_13, amount=code_block_14, step=code_block_13)
code_block_15 = CodeBlock(x=sequence) { -x; }

reverse_4 = List.Reverse(list=list_create)

# group: create an alternating sequence
code_block_16 = CodeBlock(start=code_block_7, end=max_planter_coverage_along_path, list=reverse_4)  # same code as code_block_8

planter_logitudinal_alternating = DoubleSlider(10, range=5..500 step 0.1)  # "Planter Logitudinal Alternating Offset"; graph input
code_block_17 = CodeBlock(x=code_block_16, y=planter_logitudinal_alternating) { x+y; }

# group: convert to params
code_block_18 = CodeBlock(x=code_block_17, y=length_2) { x / y; }

# group: get only the parameters less than 1
code_block_19 = CodeBlock { 1; }
lt_2 = code_block_18 < code_block_19
filterByBoolMask_2 = List.FilterByBoolMask(list=code_block_18, mask=lt_2)

splitByParameter_3 = Curve.SplitByParameter(curve=extendStart, parameters=filterByBoolMask_2.in)
code_block_20 = CodeBlock { 2; }

# group: get every other segment
dropEveryNthItem_2 = List.DropEveryNthItem(list=splitByParameter_3, n=code_block_20, offset=code_block_12)

# group: rebuild the selected segments
approximateWithArcAndLineSegments_2 = Curve.ApproximateWithArcAndLineSegments(curve=dropEveryNthItem_2)
byJoinedCurves_3 = PolyCurve.ByJoinedCurves(curves=approximateWithArcAndLineSegments_2)

code_block_21 = CodeBlock { -1; }
dropItems = List.DropItems(list=splitByParameter_3, amount=code_block_21)
code_block_22 = CodeBlock { 1; }
shiftIndices = List.ShiftIndices(list=dropItems, amount=code_block_22)
count = List.Count(list=approximateWithArcAndLineSegments, lacing=Longest)
code_block_23 = CodeBlock { 1; }

# group: if count is greater than 1, this curve should become a polycurve
gt_2 = count > code_block_23

code_block_24 = CodeBlock { true; }

# group: indices of curves that need to be rejoined
indexOf = List.IndexOf(list=gt_2, element=code_block_24)

code_block_25 = CodeBlock { -1; }
eq = indexOf == code_block_25

# group: unchanged curves
identity = Object.Identity(obj=approximateWithArcAndLineSegments)

filterByBoolMask_3 = List.FilterByBoolMask(list=approximateWithArcAndLineSegments, mask=gt_2)

# group: need to be combined into polycurves
identity_2 = Object.Identity(obj=filterByBoolMask_3.in)

# group: corrected polycurves
byJoinedCurves_4 = PolyCurve.ByJoinedCurves(curves=identity_2)

# group: replace the curves that need to be replaced
replaceItemAtIndex = List.ReplaceItemAtIndex(list=approximateWithArcAndLineSegments, index=indexOf, item=byJoinedCurves_4)

# group: if no curves to change, return the unmodified list
code_block_26 = CodeBlock(x=eq, listA=identity, listB=replaceItemAtIndex)
# ---------- code_block_26.designscript (11 lines) ----------
x;
listA;
listB;
[Imperative]
{
if (x==true) {
	return = listA;
} else {
		return = listB;
	}
};
# ----------------------------------------

flatten = List.Flatten(list=code_block_26.out3)
code_block_27 = CodeBlock(x=planter_width) { x/2; }

# group: offset either side of the planter
offset = Curve.Offset(curve=flatten, distance=code_block_27)
code_block_28 = CodeBlock(x=code_block_27) { -x; }
offset_2 = Curve.Offset(curve=flatten, distance=code_block_28)

code_block_29 = CodeBlock { false; }
clean = List.Clean(list=offset, preserveIndices=code_block_29)
clean_2 = List.Clean(list=offset_2, preserveIndices=code_block_29)
list_create_2 = List.Create(item0=clean, item1=clean_2)
transpose = List.Transpose(lists=list_create_2)

# group: create surfaces the alternate way (surfaces oriented horizontally)
byLoft = Surface.ByLoft(crossSections=transpose)

bed_thickness = DoubleSlider(0.008, range=0..1 step 0.1)  # graph input
code_block_30 = CodeBlock { true; }

# group: thicken planter bed
thicken = Surface.Thicken(surface=byLoft, thickness=bed_thickness, both_sides=code_block_30)

count_2 = List.Count(list=approximateWithArcAndLineSegments_2, lacing=Longest)
code_block_31 = CodeBlock { 1; }

# group: if count is greater than 1, this curve should become a polycurve
gt_3 = count_2 > code_block_31

code_block_32 = CodeBlock { true; }

# group: indices of curves that need to be rejoined
indexOf_2 = List.IndexOf(list=gt_3, element=code_block_32)

code_block_33 = CodeBlock { -1; }
eq_2 = indexOf_2 == code_block_33

# group: unchanged curves
identity_3 = Object.Identity(obj=approximateWithArcAndLineSegments_2)

filterByBoolMask_4 = List.FilterByBoolMask(list=approximateWithArcAndLineSegments_2, mask=gt_3)

# group: need to be combined into polycurves
identity_4 = Object.Identity(obj=filterByBoolMask_4.in)

# group: corrected polycurves
byJoinedCurves_5 = PolyCurve.ByJoinedCurves(curves=identity_4)

# group: replace the curves that need to be replaced
replaceItemAtIndex_2 = List.ReplaceItemAtIndex(list=approximateWithArcAndLineSegments_2, index=indexOf_2, item=byJoinedCurves_5)

# group: if no curves to change, return the unmodified list
code_block_34 = CodeBlock(x=eq_2, listA=identity_3, listB=replaceItemAtIndex_2)  # same code as code_block_26

flatten_2 = List.Flatten(list=code_block_34.out3)

# group: offset either side of the planter
offset_3 = Curve.Offset(curve=flatten_2, distance=code_block_27)
code_block_35 = CodeBlock(x=code_block_27) { -x; }
offset_4 = Curve.Offset(curve=flatten_2, distance=code_block_35)

code_block_36 = CodeBlock { false; }
clean_3 = List.Clean(list=offset_3, preserveIndices=code_block_36)
clean_4 = List.Clean(list=offset_4, preserveIndices=code_block_36)
list_create_3 = List.Create(item0=clean_3, item1=clean_4)
transpose_2 = List.Transpose(lists=list_create_3)

# group: create surfaces the alternate way (surfaces oriented horizontally)
byLoft_2 = Surface.ByLoft(crossSections=transpose_2)

code_block_37 = CodeBlock { true; }

# group: thicken planter bed
thicken_2 = Surface.Thicken(surface=byLoft_2, thickness=bed_thickness, both_sides=code_block_37)

# group: move alt beds out
translate_2 = Geometry.Translate(geometry=thicken_2, direction=reverse_2, distance=add, lacing=CrossProduct)

code_block_38 = CodeBlock { null; }

# group: if transverse coverage is less than the spacing, ignore the alternate band
code_block_39 = CodeBlock(listA=translate_2, listB=code_block_38)  # unwired: x; same code as code_block_26

# group: typical set of staggered planters
list_create_4 = List.Create(item0=thicken, item1=code_block_39.out3)

flatten_3 = List.Flatten(list=list_create_4)
clean_5 = List.Clean(list=flatten_3)

# group: move all beds out
translate_3 = Geometry.Translate(geometry=clean_5, direction=reverse_2, distance=sequence, lacing=CrossProduct)

# group: join all planter sets
list_create_5 = List.Create(item0=clean_5, item1=translate_3)

flatten_4 = List.Flatten(list=list_create_5)

# group: get the surfaces from the solid
explode = Geometry.Explode(geometry=flatten_4)

code_block_40 = CodeBlock { 0.5; }

# group: centroid of each surface
pointAtParameter = Surface.PointAtParameter(surface=explode, u=code_block_40, v=code_block_40)

# group: z-height of each surface
Z = Point.Z(point=pointAtParameter)

# group: smallest item - assume the solid has a single face at the bottom that is horizontal
minimumItem = List.MinimumItem(list=Z)

indexOf_3 = List.IndexOf(list=Z, element=minimumItem)

# group: get bottom surface
getItemAtIndex_2 = List.GetItemAtIndex(list=explode, index=indexOf_3)

use_plane_from_corners = BoolSelector(false)  # graph input
normalAtParameter_2 = Surface.NormalAtParameter(surface=explode, u=code_block_40, v=code_block_40)

# group: surface z-vector of each surface
Z_2 = Vector.Z(vector=normalAtParameter_2)

code_block_41 = CodeBlock { 1.00; }

# group: max z-axis delta
code_block_42 = CodeBlock { 0.5; }

# group: true for each surface that's mostly pointing up - these are the ground surfaces
eq_3 = Equals(x=Z_2, y=code_block_41, tolerance=code_block_42)

filterByBoolMask_5 = List.FilterByBoolMask(list=explode, mask=eq_3)

# group: top ground surfaces of solid
identity_5 = Object.Identity(obj=filterByBoolMask_5.in)

byUnion = Surface.ByUnion(surfaces=identity_5)

# group: boundary curves of top surfaces
perimeterCurves = Surface.PerimeterCurves(surface=byUnion)

byJoinedCurves_6 = PolyCurve.ByJoinedCurves(curves=perimeterCurves)
perimeterCurves_2 = Surface.PerimeterCurves(surface=byUnion@L2)
startPoint_2 = Curve.StartPoint(curve=perimeterCurves_2@L2)

# group: get the best fit plane across the outer corners
byBestFitThroughPoints = Plane.ByBestFitThroughPoints(points=startPoint_2@L2)

pullOntoPlane = Curve.PullOntoPlane(curve=byJoinedCurves_6, plane=byBestFitThroughPoints)
explode_2 = Geometry.Explode(geometry=byUnion)
perimeterCurves_3 = Surface.PerimeterCurves(surface=explode_2@L2)
startPoint_3 = Curve.StartPoint(curve=perimeterCurves_3@L3)
code_block_43 = CodeBlock { 1; }
flatten_5 = List.Flatten(list=startPoint_3@L3, amt=code_block_43)

# group: original curve min/max
Z_3 = Point.Z(point=flatten_5)
maximumItem = List.MaximumItem(list=Z_3)
minimumItem_2 = List.MinimumItem(list=Z_3)

# group: pulled curve min/max
explode_3 = Geometry.Explode(geometry=pullOntoPlane)
startPoint_4 = Curve.StartPoint(curve=explode_3@L2)
Z_4 = Point.Z(point=startPoint_4)
maximumItem_2 = List.MaximumItem(list=Z_4)
minimumItem_3 = List.MinimumItem(list=Z_4)

code_block_44 = CodeBlock(x=maximumItem, y=maximumItem_2) { x-y; }
code_block_45 = CodeBlock(x=code_block_44) { -x; }
edging_height = DoubleSlider(0.0833, range=0..100 step 0.1)  # graph input

# group: add edging height
code_block_46 = CodeBlock(x=code_block_45, y=edging_height) { x+y; }

# group: move plane curve up to max point
translate_4 = Geometry.Translate(geometry=pullOntoPlane, zTranslation=code_block_46)

code_block_47 = CodeBlock(x=minimumItem_3, y=minimumItem_2) { x-y; }
code_block_48 = CodeBlock(x=code_block_47) { -x; }

# group: move plane curve down to min point
translate_5 = Geometry.Translate(geometry=pullOntoPlane, zTranslation=code_block_48)

list_create_6 = List.Create(item0=translate_4, item1=translate_5)
transpose_3 = List.Transpose(lists=list_create_6)

# group: create plane-based initial surface
byLoft_3 = Surface.ByLoft(crossSections=transpose_3)

ZAxis = Vector.ZAxis()

# group: initial edging surface
extrude = Curve.Extrude(curve=byJoinedCurves_6, direction=ZAxis, distance=edging_height)

# group: use plane-based surface?
code_block_49 = CodeBlock(x=use_plane_from_corners, listA=byLoft_3, listB=extrude)
# ---------- code_block_49.designscript (11 lines) ----------
x;
listA;
listB;
[Imperative]
{
if(x==true){
	return = listA;
}else{
		return = listB;
	}
};
# ----------------------------------------

edging_thickness = DoubleSlider(0.02, range=0..100 step 0.1)  # graph input
code_block_50 = CodeBlock { false; }

# group: final edging
thicken_3 = Surface.Thicken(surface=code_block_49.out3, thickness=edging_thickness, both_sides=code_block_50)

transpose_4 = List.Transpose(lists=startPoint_3)
code_block_51 = CodeBlock { -1; }
dropItems_2 = List.DropItems(list=splitByParameter_2, amount=code_block_51)
flip_sequence = BoolSelector(false)  # graph input
lt_3 = max_planter_coverage_transverse < planter_transverse_spacing
