# Dynamo graph 5561_ListCombineCrash_AddingArrayToSingleItem.dyn (Dynamo 0.8.0.762)

add = _ + _
code_block = CodeBlock { 0..100; }
code_block_2 = CodeBlock { "foo"; }
combine = List.Combine(add, code_block, code_block_2)
