# Dynamo graph Bool_Case_3420.dyn (Dynamo 0.7.4.3192)

byCoordinates = Point.ByCoordinates()
code_block = CodeBlock { 1; }
byCenterPointRadius = Circle.ByCenterPointRadius(byCoordinates, code_block)
byPatch = Surface.ByPatch(byCenterPointRadius)
code_block_2 = CodeBlock { 0.1; }
code_block_3 = CodeBlock { true; }
thicken = Surface.Thicken(byPatch, code_block_2, code_block_3)
code_block_4 = CodeBlock { 0; }
byCoordinates_2 = Point.ByCoordinates(code_block_4, code_block_4)
ZAxis = Vector.ZAxis()
code_block_5 = CodeBlock { 1; }
byStartPointDirectionLength = Line.ByStartPointDirectionLength(byCoordinates_2, ZAxis, code_block_5)
doesIntersect = Geometry.DoesIntersect(thicken, byStartPointDirectionLength)
area = Surface.Area(thicken)
