# Dynamo graph Defect_MAGN_110.dyn (Dynamo 1.0.1.1743)

number = DoubleInput(30..180..30)
degreesToRadians = Math.DegreesToRadians(number)
radiansToDegrees = Math.RadiansToDegrees(degreesToRadians)
sin = Math.Sin(radiansToDegrees, lacing=Longest)
watch = Watch(sin)
