# Dynamo graph Defect_MAGN_1905.dyn (Dynamo 0.6.2.29585)

boolean = BoolSelector(false)
number = DoubleInput(1)
number_2 = DoubleInput(2)
add = Addition(number, number_2, lacing=Longest)
number_3 = DoubleInput(5)
number_4 = DoubleInput(6)
add_2 = Addition(number_3, number_4, lacing=Longest)
if_ = Conditional(boolean, add, add_2)
