# Dynamo graph Defect_MAGN_1968.dyn (Dynamo 0.7.2.24402)

code_block = CodeBlock { 0; {1,2}; }
create = List.Create(code_block.out0, code_block.out1)
code_block_2 = CodeBlock { 1; }
flatten = List.Flatten(create, code_block_2)
