# Dynamo graph Defect_MAGN_1971.dyn (Dynamo 0.6.3.27678)

code_block = CodeBlock { 5; }
python_script = Python(IN[0]=code_block)
# ---------- python_script.python (7 lines) ----------
# Default imports

#The inputs to this node will be stored as a list in the IN variable.
dataEnteringNode = IN

#Assign your output to the OUT variable
OUT = IN * 10
# ----------------------------------------
watch = Watch(python_script)
