# Dynamo graph Defect_MAGN_2555.dyn (Dynamo 1.0.1.1743)

code_block = CodeBlock { Point.ByCoordinates(10,10,0); 5; }
byCenterPointRadius = Sphere.ByCenterPointRadius(centerPoint=code_block.out0, radius=code_block.out1)
code_block_2 = CodeBlock { Vector.ByCoordinates(10,10,10); }
translate = Geometry.Translate(geometry=byCenterPointRadius, direction=code_block_2)
