# Dynamo graph Defect_MAGN_2566.dyn (Dynamo 1.0.1.1743)

byCoordinates = Point.ByCoordinates()
byCenterPointRadius = Sphere.ByCenterPointRadius(centerPoint=byCoordinates)
radius = Sphere.Radius(byCenterPointRadius)
X = Point.X(byCoordinates)
code_block = CodeBlock { Point.ByCoordinates(10,0,0); }
byPointsRadius = Cylinder.ByPointsRadius(byCoordinates, code_block)
identity = CoordinateSystem.Identity()
byRadiusHeight = Cylinder.ByRadiusHeight(identity)
create_list = List.Create(byPointsRadius, byRadiusHeight)
radius_2 = Cylinder.Radius(create_list)
height = Cylinder.Height(create_list)
