# Dynamo graph Defect_MAGN_3256.dyn (Dynamo 0.7.0.28779)

code_block = CodeBlock()
# ---------- code_block.designscript (3 lines) ----------
//Parameters (1)
i = 0..200..#20;
j = 0..25;
# ----------------------------------------
code_block_2 = CodeBlock(code_block.i, code_block.j)
# ---------- code_block_2.designscript (23 lines) ----------
//Geometry functions (2)
def Eta(i, j)
{
    return = 6 * Math.Cos(((3 * i + 10) * 1.8)) *
        Math.Cos( j * 7.2);
}

def Theta(i, j)
{
    return = 6 * Math.Sin(((3 * i + 10) * 1.8)) *
        Math.Cos( j * 7.2);
}

def Kappa(i, j)
{
    return = 3*i/20 + 2.5 * Math.Cos( (j + 12.5) * 7.2);
};


//Replication (3)
eta = Eta(i<1>, j<2>);
theta = Theta(i<1>, j<2>);
kappa = Kappa(i<1>, j<2>);
# ----------------------------------------
byCoordinates = Point.ByCoordinates(code_block_2.out0, code_block_2.out1, code_block_2.out2)
code_block_3 = CodeBlock(pt=byCoordinates) { ptOut = pt[0][0].X; }
