# Dynamo graph Defect_MAGN_3417.dyn (Dynamo 0.7.0.34351)

origin = Point.Origin()
code_block = CodeBlock { 10; }
byCenterPointRadius = Sphere.ByCenterPointRadius(origin, code_block)
byLengths = Cuboid.ByLengths(code_block, code_block, code_block)
code_block_2 = CodeBlock { 0.5; }
thinShell = Solid.ThinShell(byLengths, code_block_2, code_block_2)
