# Dynamo graph Defect_MAGN_3548.dyn (Dynamo 0.7.2.26879)

byCoordinates = Point.ByCoordinates()
code_block = CodeBlock { 10; }
byCoordinates_2 = Point.ByCoordinates(code_block)
byCoordinates_3 = Point.ByCoordinates(code_block, code_block)
byThreePoints = Arc.ByThreePoints(byCoordinates, byCoordinates_2, byCoordinates_3)
byStartPointEndPoint = Line.ByStartPointEndPoint(byCoordinates, byCoordinates_3)
code_block_2 = CodeBlock { 2; }
byCoordinates_4 = Vector.ByCoordinates()
byThickeningCurve = PolyCurve.ByThickeningCurve(byStartPointEndPoint, code_block_2, byCoordinates_4)
ZAxis = Vector.ZAxis()
extrudeAsSolid = Curve.ExtrudeAsSolid(byThickeningCurve, ZAxis)
