# Dynamo graph Defect_MAGN_3648.dyn (Dynamo 1.0.1.1743)

code_block = CodeBlock { foo(); }
byCoordinates = Point.ByCoordinates(x=code_block)
code_block_2 = CodeBlock()
# ---------- code_block_2.designscript (6 lines) ----------
def foo()
{
 return = 1;
}

3;
# ----------------------------------------
byCenterPointRadius = Sphere.ByCenterPointRadius(centerPoint=byCoordinates, radius=code_block_2)
