# Dynamo graph Defect_MAGN_3714.dyn (Dynamo 0.7.0.34351)

byCoordinates = Point.ByCoordinates()
code_block = CodeBlock { 5; }
byCoordinates_2 = Point.ByCoordinates(code_block)
byStartPointEndPoint = Line.ByStartPointEndPoint(byCoordinates, byCoordinates_2)
divideEqually = Curve.DivideEqually(byStartPointEndPoint, code_block)
