# Dynamo graph Defect_MAGN_3726.dyn (Dynamo 0.7.0.34351)

number = DoubleInput(0..54..10)
fromObject = String.FromObject(number, lacing=Longest)
string = StringInput("a")
concat = String.Concat(arg1=string)
map = List.Map(fromObject, concat)
