# Dynamo graph Defect_MAGN_3998.dyn (Dynamo 0.7.2.30936)

code_block = CodeBlock()
# ---------- code_block.designscript (26 lines) ----------
// Draw a Hockey rink
// Set width and depth of rink, radius of corner
x = 60.96;
y = 25.9;
rad = 6.5;

p1a = Point.ByCoordinates(x/2-rad,y/2);
p1b = Point.ByCoordinates(x/2,y/2-rad);
p2a = Point.ByCoordinates(-x/2,y/2-rad);
p2b = Point.ByCoordinates(-x/2+rad,y/2);
p3a = Point.ByCoordinates(-x/2+rad,-y/2);
p3b = Point.ByCoordinates(-x/2,-y/2+rad);
p4a = Point.ByCoordinates(x/2,-y/2+rad);
p4b = Point.ByCoordinates(x/2-rad,-y/2);

L1 = Line.ByStartPointEndPoint(p1a, p2b);
L2 = Line.ByStartPointEndPoint(p2a, p3b);
L3 = Line.ByStartPointEndPoint(p3a, p4b);
L4 = Line.ByStartPointEndPoint(p4a, p1b);

A1 = Arc.ByFillet(L4,L1,rad);
A2 = Arc.ByFillet(L1,L2,rad);
A3 = Arc.ByFillet(L2,L3,rad);
A4 = Arc.ByFillet(L3,L4,rad);

PolyCurve.ByJoinedCurves({A1,L1,A2,L2,A3,L3,A4,L4});
# ----------------------------------------
code_block_2 = CodeBlock { 2; }
boolean = BoolSelector(false)
offset = PolyCurve.Offset(code_block.out19, code_block_2, boolean)
code_block_3 = CodeBlock { 0..1..#100; }
pointAtParameter = Curve.PointAtParameter(offset, code_block_3)
# note: Connecting this causes crash
tangentAtParameter = Curve.TangentAtParameter(offset, code_block_3)
