# Dynamo graph Defect_MAGN_4046.dyn (Dynamo 0.7.1.17276)

integer_slider = IntegerSlider(55, range=0..100)
code_block = CodeBlock(x=integer_slider) { t= {{0, 1}, {x, 3}}; v_out0 = t[0]; v_out1 = t[1]; v = {}; v["out"] = v_out1; }
create = List.Create(code_block.out4)
