# Dynamo graph Defect_MAGN_4105.dyn (Dynamo 0.7.1.22111)

code_block = CodeBlock { Point.ByCoordinates(0, 0); Point.ByCoordinates(10, 3); Point.ByCoordinates(20, 0); Point.ByCoordinates(30, 3); }
create = List.Create(code_block.out0, code_block.out1, code_block.out2, code_block.out3)
byPoints = NurbsCurve.ByPoints(create)
YAxis = Vector.YAxis()
code_block_2 = CodeBlock { 10; }
extrude = Curve.Extrude(byPoints, YAxis, code_block_2)
perimeterCurves = Surface.PerimeterCurves(extrude)
byJoinedCurves = PolyCurve.ByJoinedCurves(perimeterCurves)
watch = Watch(byJoinedCurves)
code_block_3 = CodeBlock { 4; }
translate = Geometry.Translate(byJoinedCurves, arg3=code_block_3)
watch_2 = Watch(translate)
