# Dynamo graph Defect_MAGN_4364.dyn (Dynamo 0.7.2.36621)

code_block = CodeBlock { "10"; "Jack"; "Dynamo"; "King"; "40"; }
create = List.Create(code_block.out0, code_block.out1, code_block.out2, code_block.out3, code_block.out4)
watch_1 = Watch(create)
code_block_2 = CodeBlock { {"foo", "bar"}; }
watch_2 = Watch(code_block_2)
code_block_3 = CodeBlock { "a"; }
code_block_4 = CodeBlock { "b"; }
code_block_5 = CodeBlock { "c"; }
code_block_6 = CodeBlock { "d"; }
create_2 = List.Create(code_block_3, code_block_4, code_block_5, code_block_6)
watch_3 = Watch(create_2)
code_block_7 = CodeBlock { "a"; }
watch_4 = Watch(code_block_7)
code_block_8 = CodeBlock { 1; }
code_block_9 = CodeBlock { 2; }
code_block_10 = CodeBlock { 3; }
create_3 = List.Create(code_block_8, code_block_9, code_block_10)
watch_5 = Watch(create_3)
code_block_11 = CodeBlock { {1,2,3,4}; }
watch_6 = Watch(code_block_11)
code_block_12 = CodeBlock { {1..2, 1..2}; }
flatten = Flatten(code_block_12)
watch_7 = Watch(flatten)
