# Dynamo graph Defect_MAGN_847.dyn (Dynamo 0.7.1.17276)

# note: Extract sortable information from a piece of data
# note: Sort data into different buckets
# note: Operate on data inside of lists
# note: Passing functions to other functions allows for a "do this to all these things" set of operations

number = DoubleInput(0..2)
number_2 = DoubleInput(3..5)
number_3 = DoubleInput(6..9)
create_list = List.Create(number, number_2, number_3)
create_list_2 = List.Create()
combine = List.Combine(create_list_2, number, number_2, number_3)
watch = Watch(combine)
