# Dynamo graph Defect_MAGN_942_GreaterThan.dyn (Dynamo 1.0.1.1743)

number = DoubleInput(0)
number_2 = DoubleInput(10)
number_3 = DoubleInput(1)
range = Range(start=number, end=number_2, step=number_3, lacing=Longest)
watch = Watch(range)
number_4 = DoubleInput(4)
greaterThan = Compare.GreaterThan(arg1=number_4)
map = List.Map(list=watch, f_x=greaterThan)
watch_2 = Watch(map)
