# Dynamo graph Defect_MAGN_942_GreaterThanOrEqual.dyn (Dynamo 1.0.1.1743)

number = DoubleInput(0)
number_2 = DoubleInput(10)
number_3 = DoubleInput(1)
range = Range(start=number, end=number_2, step=number_3, lacing=Longest)
number_4 = DoubleInput(5)
greaterThanOrEqual = Compare.GreaterThanOrEqual(arg1=number_4)
map = List.Map(list=range, f_x=greaterThanOrEqual)
watch = Watch(map)
watch_2 = Watch(number_4)
formula = Formula("x>=y", x=range, y=watch_2, lacing=Longest)
watch_3 = Watch(formula)
