# Dynamo graph Defect_MAGN_942_LessThan.dyn (Dynamo 1.0.1.1743)

number = DoubleInput(0)
number_2 = DoubleInput(5)
number_3 = DoubleInput(-1)
sequence = Sequence(start=number, amount=number_2, step=number_3, lacing=Longest)
watch = Watch(sequence)
number_4 = DoubleInput(4)
lessThan = Compare.LessThan(arg1=number_4)
map = List.Map(list=watch, f_x=lessThan)
watch_2 = Watch(map)
