# Dynamo graph Defect_MAGN_942_LessThanOrEqual.dyn (Dynamo 1.0.1.1743)

number = DoubleInput(10)
number_2 = DoubleInput(1)
number_3 = DoubleInput(-5)
number_4 = DoubleInput(-4.5)
number_5 = DoubleInput(15.23)
number_6 = DoubleInput(5)
create_list = List.Create(number, number_2, number_3, number_4, number_5, number_6)
number_7 = DoubleInput(5)
lessThanOrEqual = Compare.LessThanOrEqual(arg1=number_7)
map = List.Map(list=create_list, f_x=lessThanOrEqual)
watch = Watch(map)
formula = Formula("x<=y", x=create_list, y=number_7, lacing=Longest)
watch_2 = Watch(formula)
