# Dynamo graph EqualEqualTestForSting_6694.dyn (Dynamo 0.8.1.1191)

code_block = CodeBlock { "DesignScript"; "Dynamo"; }
eq = code_block.out0 == code_block.out1
code_block_2 = CodeBlock { "DesignScript"; "Dynamo"; }
eq_2 = code_block_2.out1 == code_block_2.out1
