# Dynamo graph simplified_circular_dep2.dyn (Dynamo 2.13.0.2136)

code_block = CodeBlock(a=add) { a; }
code_block_2 = CodeBlock(b=code_block) { b; }
code_block_3 = CodeBlock { 2; 3; }
add = code_block_2 + code_block_3.out1
