# Dynamo graph ExternalReferencesTest.dyn (Dynamo 2.13.0.2773)

code_block = CodeBlock { srcpath ="C:\\test\\"; path = "C:\\test\\DynamoTest.xlsx"; 3; filepath = srcpath + "Dynamo.png"; }
code_block_2 = CodeBlock(x=code_block.path) { x; }
file_from_path = FileObject(path=code_block.filepath)
readFromFile = Image.ReadFromFile(file=file_from_path)
