# Dynamo graph TestFrozenNodesOnDisconnecting.dyn (Dynamo 0.9.1.3505)

code_block = CodeBlock(lacing=Longest) { 0..50..#9; }
byCoordinates = Point.ByCoordinates(x=code_block, y=code_block, lacing=CrossProduct)
flatten = Flatten(byCoordinates)
code_block_2 = CodeBlock { 0; }
point_x = DoubleSlider(23.6, range=0..100 step 0.1)  # frozen
point_y = DoubleSlider(17.8, range=0..100 step 0.1)
byCoordinates_2 = Point.ByCoordinates(x=point_x, y=point_y)
distanceTo = Geometry.DistanceTo(geometry=flatten, other=byCoordinates_2, lacing=Longest)
code_block_3 = CodeBlock(x=distanceTo) { x/2; }
byCoordinates_3 = Vector.ByCoordinates(x=code_block_2, y=code_block_2, z=code_block_3)
add = Point.Add(point=flatten, vectorToAdd=byCoordinates_3)
code_block_4 = CodeBlock(x=distanceTo) { x/15; }
byPointsRadius = Cylinder.ByPointsRadius(flatten, add, code_block_4)
code_block_5 = CodeBlock { a=Color.ByARGB(255,0,0,255); b=Color.ByARGB(255,255,0,0); colors={a,b}; indices = {0,1}; 0..1..#100; }
radius = Cylinder.Radius(byPointsRadius)
maximumItem = List.MaximumItem(radius)
div = radius / maximumItem
color_range = ColorRange(code_block_5.colors, code_block_5.indices, div)
byGeometryColor = Display.Display.ByGeometryColor(byPointsRadius, color_range)
