# Dynamo graph TestFrozenOnGeometry.dyn (Dynamo 0.9.1.3415)

number = DoubleInput(0)
byCoordinates = Point.ByCoordinates(x=number, y=number, z=number)
number_2 = DoubleInput(10)
byCoordinates_2 = Point.ByCoordinates(x=number_2, y=number_2, z=number_2)
byStartPointEndPoint = Line.ByStartPointEndPoint(startPoint=byCoordinates, endPoint=byCoordinates_2)
watch = Watch(byStartPointEndPoint)
code_block = CodeBlock { 10; }
byLengths = Cuboid.ByLengths(width=code_block)
watch_3d = Watch3D(byLengths)
