# Dynamo graph Arc.ByCenterPointRadiusAngle.Array.dyn (Dynamo 0.6.3.35885)

code_block = CodeBlock { 1..100..10; 0; 90; 180; radius=2; }
byCoordinates = DSFunction(code_block.out0, code_block.out1, code_block.out1)  # "Point.ByCoordinates"
code_block_2 = CodeBlock { normal = 1; }
byCoordinates_2 = DSFunction(code_block.out1, code_block_2, code_block.out1)  # "Vector.ByCoordinates"
byCenterPointRadiusAngle = DSFunction(byCoordinates, code_block.radius, code_block.out2, code_block.out3, byCoordinates_2)  # "Arc.ByCenterPointRadiusAngle"
