# Dynamo graph Arc.ByCenterPointRadiusAngle.Simple.dyn (Dynamo 0.6.3.35885)

code_block = CodeBlock { 0; 90; 180; }
byCoordinates = DSFunction(code_block.out0, code_block.out0, code_block.out0)  # "Point.ByCoordinates"
code_block_2 = CodeBlock { 4; }
code_block_3 = CodeBlock { 1; }
byCoordinates_2 = DSFunction(code_block.out0, code_block.out0, code_block_3)  # "Vector.ByCoordinates"
byCenterPointRadiusAngle = DSFunction(byCoordinates, code_block_2, code_block.out1, code_block.out2, byCoordinates_2)  # "Arc.ByCenterPointRadiusAngle"
