# Dynamo graph Arc.ByCenterPointStartPointSweepAngle.Array.dyn (Dynamo 0.6.3.35885)

code_block = CodeBlock { 10..100..10; 5; 0; }
byCoordinates = DSFunction(code_block.out0, code_block.out2, code_block.out2)  # "Point.ByCoordinates"
byCoordinates_2 = DSFunction(code_block.out2, code_block.out2, code_block.out2)  # "Point.ByCoordinates"
code_block_2 = CodeBlock { 180; }
byCenterPointStartPointSweepAngle = DSFunction(byCoordinates, byCoordinates_2, code_block_2)  # "Arc.ByCenterPointStartPointSweepAngle"
getSweepAngle = DSFunction(byCenterPointStartPointSweepAngle)  # "Arc.getSweepAngle"
getCenterPoint = DSFunction(byCenterPointStartPointSweepAngle)  # "Arc.getCenterPoint"
getRadius = DSFunction(byCenterPointStartPointSweepAngle)  # "Arc.getRadius"
