# Dynamo graph Arc.ByCenterPointStartPointSweepAngle.Simple.dyn (Dynamo 0.6.3.35885)

code_block = CodeBlock { 0; 5; }
byCoordinates = DSFunction(code_block.out0, code_block.out0, code_block.out0)  # "Point.ByCoordinates"
byCoordinates_2 = DSFunction(code_block.out1, code_block.out0, code_block.out0)  # "Point.ByCoordinates"
code_block_2 = CodeBlock { 180; }
byCenterPointStartPointSweepAngle = DSFunction(byCoordinates, byCoordinates_2, code_block_2)  # "Arc.ByCenterPointStartPointSweepAngle"
getCenterPoint = DSFunction(byCenterPointStartPointSweepAngle)  # "Arc.getCenterPoint"
getRadius = DSFunction(byCenterPointStartPointSweepAngle)  # "Arc.getRadius"
getSweepAngle = DSFunction(byCenterPointStartPointSweepAngle)  # "Arc.getSweepAngle"
