# Dynamo graph BSplineCurve.ByControlVertices.Degree.Simple.dyn (Dynamo 1.0.1.1743)

code_block = CodeBlock { 0; 5; }
byCoordinates = Point.ByCoordinates(x=code_block.out0, y=code_block.out0, z=code_block.out0)
byCoordinates_2 = Point.ByCoordinates(x=code_block.out1, y=code_block.out0, z=code_block.out0)
byCoordinates_3 = Point.ByCoordinates(x=code_block.out1, y=code_block.out1, z=code_block.out0)
byCoordinates_4 = Point.ByCoordinates(x=code_block.out0, y=code_block.out1, z=code_block.out0)
code_block_2 = CodeBlock(p1=byCoordinates, p2=byCoordinates_2, p3=byCoordinates_3, p4=byCoordinates_4) { arrayOfPoints  = {p1,p2,p3,p4}; degree = 2; }
byControlVertices = NurbsCurve.ByControlVertices(code_block_2.arrayOfPoints, code_block_2.degree)
