# Dynamo graph Circle.CenterPointRadiusNormal.Simple.dyn (Dynamo 0.6.3.21749)

code_block = CodeBlock { p1 = Point.ByCoordinates(00,0,0); }
code_block_2 = CodeBlock { 5; normal = Vector.ByCoordinates(0,0,1); }
byCenterPointRadius = Circle.ByCenterPointRadius(code_block, code_block_2.out0, code_block_2.normal)
