# Dynamo graph Circle.PropertyCheck.Simple.dyn (Dynamo 1.0.1.1743)

code_block = CodeBlock { Point.ByCoordinates(00,0,0); }
code_block_2 = CodeBlock { 5; 0; }
byCoordinates = Point.ByCoordinates(x=code_block_2.out0, y=code_block_2.out0, z=code_block_2.out1)
code_block_3 = CodeBlock { 10; 0; }
byCoordinates_2 = Point.ByCoordinates(x=code_block_3.out0, y=code_block_3.out1, z=code_block_3.out1)
byPointsOnCurve = Circle.ByPointsOnCurve(code_block, byCoordinates, byCoordinates_2)
centerPoint = Circle.CenterPoint(byPointsOnCurve)
firstPoint = Circle.FirstPoint(byPointsOnCurve)
normal = Circle.Normal(byPointsOnCurve)
pointOnCurve = Circle.PointOnCurve(byPointsOnCurve)
radius = Circle.Radius(byPointsOnCurve)
secondPoint = Circle.SecondPoint(byPointsOnCurve)
thirdPoint = Circle.ThirdPoint(byPointsOnCurve)
