# Dynamo graph CoordinateSystem.AtParameter.Surface.dyn (Dynamo 1.0.1.1743)

code_block = CodeBlock()
# ---------- code_block.designscript (8 lines) ----------
points      = Point.ByCoordinates(4, 0, 0..7);
points[1]   = points[1].Translate(-1, 0, 0);
points[5]   = points[5].Translate(1, 0, 0);
curve = NurbsCurve.ByPoints(points);
axisOrigin  = Point.ByCoordinates(0, 0, 0);
axis        = Vector.ByCoordinates(0, 0, 1);
startAngle = 0;
endAngle=360;
# ----------------------------------------
byProfileAxisOriginDirectionAngle = RevolvedSurface.ByProfileAxisOriginDirectionAngle(code_block.out1, code_block.out2, code_block.curve, code_block.axisOrigin, code_block.axis)
code_block_2 = CodeBlock { 0.5; 0.25; }
atParameter = CoordinateSystem.AtParameter(byProfileAxisOriginDirectionAngle, code_block_2.out0, code_block_2.out1)
watch_3d = Watch3D(code_block.out1)
