# Dynamo graph CoordinateSystem.ByCylindricalCoordinates.Simple.dyn (Dynamo 1.0.1.1743)

code_block = CodeBlock { Point.ByCoordinates(0,0,0); Vector.ByCoordinates(1,0,0); Vector.ByCoordinates(0,1,0); }
byOriginVectors = CoordinateSystem.ByOriginVectors(origin=code_block.out0, xAxis=code_block.out1, yAxis=code_block.out2)
code_block_2 = CodeBlock { radius = 1; theta  = 0..180..60; height = 1; }
byCylindricalCoordinates = CoordinateSystem.ByCylindricalCoordinates(byOriginVectors, code_block_2.radius, code_block_2.theta, code_block_2.height)
