# Dynamo graph CoordinateSystem.BySphericallCoordinates.Simple.dyn (Dynamo 1.0.1.1743)

WCS = CoordinateSystem.WCS()
code_block = CodeBlock()
# ---------- code_block.designscript (4 lines) ----------
radius  = 1;
theta   = 0..180..60;
// this can be a singleton as well;
phi  = 45;
# ----------------------------------------
bySphericalCoordinates = CoordinateSystem.BySphericalCoordinates(WCS, code_block.radius, code_block.theta, code_block.phi)
