# Dynamo graph Curve.Composite.Simple.dyn (Dynamo 0.6.3.12415)

code_block = CodeBlock()
# ---------- code_block.designscript (13 lines) ----------
point1          = Point.ByCoordinates(0, 0, 0);
point2          = Point.ByCoordinates(10, 0, 0);
centerPoint     = Point.ByCoordinates(9, 6, 0);
myArc           = Arc.ByCenterPointRadiusAngle(centerPoint, 3, -90, 180, Vector.ByCoordinates(0, 0, 1));
arrayOfPoints   = { point1, point1.Translate(3, 3, 0), point1.Translate(6, 0, 0), point1.Translate(9, 3, 0) };
mySpline        = NurbsCurve.ByPoints(arrayOfPoints);
startPoint1     = myArc.EndPoint;
myLine1         = Line.ByStartPointDirectionLength(
                                startPoint1, Vector.ByCoordinates(-1, 0, 0),9);
startPoint2     = myLine1.EndPoint;
myLine2         = Line.ByStartPointDirectionLength(startPoint2, Vector.ByCoordinates(0, -1, 0),9);

arrayCurve = {myArc, mySpline, myLine1, myLine2};
# ----------------------------------------
code_block_2 = CodeBlock(arayCurve=code_block.arrayCurve) { compositeCurve = Curve.Composite(arayCurve); }
