# Dynamo graph Curve.Extrude.ArrayOfLines.dyn (Dynamo 0.6.3.27769)

code_block = CodeBlock { 0..5..0.5; 0; 10; }
byCoordinates = Point.ByCoordinates(code_block.out1, code_block.out1, code_block.out0)
byCoordinates_2 = Point.ByCoordinates(code_block.out2, code_block.out1, code_block.out0)
byStartPointEndPoint = Line.ByStartPointEndPoint(byCoordinates, byCoordinates_2)
code_block_2 = CodeBlock { Vector.ByCoordinates(0,1,0); }
extrude = Curve.Extrude(byStartPointEndPoint, code_block.out2, code_block_2)
