# Dynamo graph Curve.HorizontalFrameAtParameter.Circle.dyn (Dynamo 2.0.0.4093)

code_block = CodeBlock()
# ---------- code_block.designscript (4 lines) ----------
center      = Point.ByCoordinates(0, 0, 0);
radius      = 10;
circle      = Circle.ByCenterPointRadius(center, radius);
parameters  = [0.0, 0.25, 0.5, 0.75];
# ----------------------------------------
horizontalFrameAtParameter = Curve.HorizontalFrameAtParameter(code_block.circle, code_block.parameters)
YAxis = CoordinateSystem.YAxis(horizontalFrameAtParameter)
watch_yaxis = Watch(YAxis)
ZAxis = CoordinateSystem.ZAxis(horizontalFrameAtParameter)
watch_zaxis = Watch(ZAxis)
origin = CoordinateSystem.Origin(horizontalFrameAtParameter)
watch_origin = Watch(origin)
