# Dynamo graph Curve.Offset.dyn (Dynamo 0.6.3.12415)

WCS = CoordinateSystem.WCS()
origin = CoordinateSystem.Origin(WCS)
XAxis = CoordinateSystem.XAxis(WCS)
code_block = CodeBlock { 10; 2; }
byStartPointDirectionLength = Line.ByStartPointDirectionLength(origin, XAxis, code_block.out0)
offset = Curve.Offset(byStartPointDirectionLength, code_block.out1)
