# Dynamo graph Curve.PlaneAtDistance.Simple.dyn (Dynamo 0.6.3.12415)

code_block = CodeBlock()
# ---------- code_block.designscript (11 lines) ----------
point1              = Point.ByCoordinates(0,0,0);
point2              = Point.ByCoordinates(0,10,0);
curve               = Line.ByStartPointEndPoint(point1, point2);
distanceForPlane    = 8;
myPlaneAtDistance = curve.PlaneAtDistance(distanceForPlane);

myPlaneOrigin       = myPlaneAtDistance.Origin;
myPlaneNormal       = myPlaneAtDistance.Normal;
myPlaneSize         = myPlaneAtDistance.Size;
myPlaneDistance     = myPlaneAtDistance.Distance;
myPlaneParameter    = myPlaneAtDistance.T;
# ----------------------------------------
watch = Watch(code_block.myPlaneOrigin)
watch_2 = Watch(code_block.myPlaneDistance)
watch_3 = Watch(code_block.myPlaneNormal)
watch_4 = Watch(code_block.myPlaneParameter)
watch_5 = Watch(code_block.myPlaneSize)
