# Dynamo graph Curve.PlaneAtEqualArcLength.dyn (Dynamo 0.6.3.12415)

code_block = CodeBlock()
# ---------- code_block.designscript (4 lines) ----------
point1              = Point.ByCoordinates(0,0,0);
point2              = Point.ByCoordinates(0,10,0);
curve               = Line.ByStartPointEndPoint(point1, point2);
numberOfPlane       = 3;
# ----------------------------------------
planesAtEqualArcLength = Curve.PlanesAtEqualArcLength(code_block.curve, code_block.numberOfPlane)
