# Dynamo graph Curve.PointAtParameter.Surface.dyn (Dynamo 1.0.1.1743)

code_block = CodeBlock()
# ---------- code_block.designscript (3 lines) ----------
l1 = Line.ByStartPointDirectionLength(Point.ByCoordinates(0,0,0), Vector.ByCoordinates(1,0,0), 10);
v1 = Vector.ByCoordinates(0,0,1);
10;
# ----------------------------------------
extrude = Curve.Extrude(curve=code_block.l1, distance=code_block.out2)
code_block_2 = CodeBlock { 0..1..0.25; }
pointAtParameter = Surface.PointAtParameter(surface=extrude, u=code_block_2, v=code_block_2)
