# Dynamo graph Curve.Project.OnPlane.dyn (Dynamo 0.6.3.12415)

code_block = CodeBlock { Point.ByCoordinates(0,2,2); 1; }
byCenterPointRadius = Circle.ByCenterPointRadius(code_block.out0, code_block.out1)
code_block_2 = CodeBlock { Point.ByCoordinates(0,0,0); Vector.ByCoordinates(0,0,1); }
byOriginNormal = Plane.ByOriginNormal(code_block_2.out0, code_block_2.out1)
project = Curve.Project(byCenterPointRadius, byOriginNormal)
