# Dynamo graph Curve.Project.Plane.Simple.dyn (Dynamo 0.6.3.39856)

code_block = CodeBlock { 0; 10; }
byCoordinates = DSFunction(code_block.out0, code_block.out0, code_block.out0)  # "Point.ByCoordinates"
byCoordinates_2 = DSFunction(code_block.out1, code_block.out0, code_block.out0)  # "Point.ByCoordinates"
byStartPointEndPoint = DSFunction(byCoordinates, byCoordinates_2)  # "Line.ByStartPointEndPoint"
byCoordinates_3 = DSFunction(code_block.out0, code_block.out0, code_block.out1)  # "Point.ByCoordinates"
code_block_2 = CodeBlock { 0;1; }
byCoordinates_4 = DSFunction(code_block_2.out0, code_block_2.out0, code_block_2.out1)  # "Vector.ByCoordinates"
byOriginNormal = DSFunction(byCoordinates_3, byCoordinates_4)  # "Plane.ByOriginNormal"
project = DSFunction(byStartPointEndPoint, byOriginNormal)  # "Curve.Project"
