# Dynamo graph Curve.Reverse.dyn (Dynamo 1.0.1.1743)

code_block = CodeBlock()
# ---------- code_block.designscript (3 lines) ----------
startPoint      = Point.ByCoordinates(0,0,0);
endPoint        = Point.ByCoordinates(10,0,0);
curveForReverse = Line.ByStartPointEndPoint(startPoint, endPoint);
# ----------------------------------------
reverse = Curve.Reverse(code_block.curveForReverse)
startPoint = Curve.StartPoint(reverse)
endPoint = Curve.EndPoint(reverse)
isCircular = Curve.IsCircular(reverse)
isClosed = Curve.IsClosed(reverse)
isElliptical = Curve.IsElliptical(reverse)
isLinear = Curve.IsLinear(reverse)
isPlanar = Curve.IsPlanar(reverse)
length = Curve.Length(reverse)
