# Dynamo graph Curve.RevolveAsSolid.AxisPointDirection.EdgeProperty.dyn (Dynamo 1.0.1.1743)

code_block = CodeBlock()
# ---------- code_block.designscript (5 lines) ----------
WCS = CoordinateSystem.Identity();
profile     = Circle.ByCenterPointRadius(Point.ByCoordinates(10, 0, 0), 4, WCS.ZAxis);
axisPoint   = Point.ByCoordinates(0, 0, 0);
axisDir     = Vector.ByCoordinates(1, 1, 1);
myRevolvedSolid = profile.RevolveAsSolid(axisPoint, axisDir);
# ----------------------------------------
edges = Solid.Edges(code_block.myRevolvedSolid)
shells = Solid.Shells(code_block.myRevolvedSolid)
faces = Solid.Faces(code_block.myRevolvedSolid)
vertices = Solid.Vertices(code_block.myRevolvedSolid)
WCS = CoordinateSystem.WCS()
code_block_2 = CodeBlock { 5; }
byLengths = Cuboid.ByLengths(width=WCS, length=code_block_2, height=code_block_2)
edges_2 = Solid.Edges(byLengths)
shells_2 = Solid.Shells(byLengths)
faces_2 = Solid.Faces(byLengths)
vertices_2 = Solid.Vertices(byLengths)
