# Dynamo graph Curve.RevolveAsSolid.StartSweep.dyn (Dynamo 1.0.1.1743)

code_block = CodeBlock { 1; 0; 2; 10; }
byCoordinates = Vector.ByCoordinates(x=code_block.out1, y=code_block.out0, z=code_block.out1)
byCoordinates_2 = Point.ByCoordinates(x=code_block.out3, y=code_block.out1, z=code_block.out1)
byCenterPointRadius = Circle.ByCenterPointRadius(centerPoint=byCoordinates_2, radius=code_block.out2)
byCoordinates_3 = Point.ByCoordinates(x=code_block.out1, y=code_block.out1, z=code_block.out1)
code_block_2 = CodeBlock { Vector.ByCoordinates(0,0,1); 10; }
byStartPointDirectionLength = Line.ByStartPointDirectionLength(startPoint=byCoordinates_3, direction=code_block_2.out0, length=code_block_2.out1)
code_block_3 = CodeBlock { 0; 180; }
revolveAsSolid = Curve.RevolveAsSolid(byCenterPointRadius, byStartPointDirectionLength, code_block_3.out0)
