# Dynamo graph Curve.Split.Simple.dyn (Dynamo 1.0.1.1743)

code_block = CodeBlock { p1 = Point.ByCoordinates(0,0,0); }
code_block_2 = CodeBlock { Point.ByCoordinates(5,5,0); }
code_block_3 = CodeBlock { xDistance = 10; }
code_block_4 = CodeBlock(xDistance=code_block_3) { p3 = Point.ByCoordinates(xDistance,0,0); }
byPointsOnCurve = Arc.ByPointsOnCurve(code_block, code_block_2, code_block_4)
code_block_5 = CodeBlock(curve=byPointsOnCurve) { splittedCurve = curve.Split(0.5); }
code_block_6 = CodeBlock(splittedCurve=code_block_5) { splittedCurve1 = splittedCurve[0]; }
split = Curve.Split(byPointsOnCurve)
code_block_7 = CodeBlock { 0.5; }
