# Dynamo graph Curve.Trim.UsingParameters.dyn (Dynamo 0.6.3.39524)

code_block = CodeBlock()
# ---------- code_block.designscript (6 lines) ----------
Point.ByCoordinates(0,0,0);
Point.ByCoordinates(5,0,5);
Point.ByCoordinates(10,0,0);
startParam = 0.25;
endParam = 0.5;
discardBetweenParam = false;
# ----------------------------------------
byPointsOnCurve = Arc.ByPointsOnCurve(code_block.out0, code_block.out1, code_block.out2)
trim = Curve.Trim(byPointsOnCurve, code_block.startParam, code_block.endParam, code_block.discardBetweenParam)
