# Dynamo graph Geometry.Transform.Simple.dyn (Dynamo 1.0.1.1743)

WCS = CoordinateSystem.WCS()
code_block = CodeBlock { 3; 10; 0; }
scale = CoordinateSystem.Scale(WCS, code_block.out0)
translate = Geometry.Translate(geometry=scale, xTranslation=code_block.out1, yTranslation=code_block.out2, zTranslation=code_block.out2)
ZAxis = CoordinateSystem.ZAxis(WCS)
origin = CoordinateSystem.Origin(WCS)
code_block_2 = CodeBlock { 1; }
byCenterPointRadius = Circle.ByCenterPointRadius(centerPoint=origin, radius=code_block_2)
extrude = Curve.Extrude(curve=byCenterPointRadius, distance=code_block.out0)
transform = Geometry.Transform(extrude, WCS)
