# Dynamo graph Line.PropertyCheck.dyn (Dynamo 1.0.1.1743)

code_block = CodeBlock { Point.ByCoordinates(0..100..#10,0,0); Vector.ByCoordinates(0,0,1); 1..10; }
byStartPointDirectionLength = Line.ByStartPointDirectionLength(startPoint=code_block.out0, direction=code_block.out1, length=code_block.out2)
direction = Line.Direction(byStartPointDirectionLength)
endPoint = Curve.EndPoint(byStartPointDirectionLength)
startPoint = Curve.StartPoint(byStartPointDirectionLength)
length = Curve.Length(byStartPointDirectionLength)
