# Dynamo graph LineByStartPointDirectionLenght.Simple.dyn (Dynamo 1.0.1.1743)

identity = CoordinateSystem.Identity()
origin = CoordinateSystem.Origin(identity)
YAxis = CoordinateSystem.YAxis(identity)
code_block = CodeBlock { 5; 10; 15; }
byStartPointDirectionLength = Line.ByStartPointDirectionLength(startPoint=origin, direction=YAxis, length=code_block.out1)
XAxis = CoordinateSystem.XAxis(identity)
byStartPointDirectionLength_2 = Line.ByStartPointDirectionLength(startPoint=origin, direction=XAxis, length=code_block.out0)
ZAxis = CoordinateSystem.ZAxis(identity)
byStartPointDirectionLength_3 = Line.ByStartPointDirectionLength(startPoint=origin, direction=ZAxis, length=code_block.out2)
