# Dynamo graph LoftFromScrossections.Simple.dyn (Dynamo 1.0.1.1743)

code_block = CodeBlock { p4 = Point.ByCoordinates(20,0,10); p5 = p4.Translate(0,5,5); p6 = p4.Translate(0,10,0); }
byPointsOnCurve = Circle.ByPointsOnCurve(code_block.p4, code_block.p5, code_block.p6)
code_block_2 = CodeBlock { p1 = Point.ByCoordinates(0,0,0); p2 = p1.Translate(0,5,5); p3 = p1.Translate(0,10,0); }
byPointsOnCurve_2 = Circle.ByPointsOnCurve(code_block_2.p1, code_block_2.p2, code_block_2.p3)
byPointsOnCurve_3 = Arc.ByPointsOnCurve(code_block_2.p1, code_block_2.p2, code_block_2.p3)
byPointsOnCurve_4 = Arc.ByPointsOnCurve(code_block.p4, code_block.p5, code_block.p6)
code_block_3 = CodeBlock(a=byPointsOnCurve_3, b=byPointsOnCurve_4) { a; b; c={a,b}; }
fromCrossSections = LoftedSurface.FromCrossSections(code_block_3.c)
