# Dynamo graph Plane.Offset.Simple.dyn (Dynamo 1.0.1.1743)

code_block = CodeBlock { direction = Vector.ByCoordinates(0,0,1); offset= 10; Point.ByCoordinates(0,0,0); }
byOriginNormal = Plane.ByOriginNormal(origin=code_block.out2, normal=code_block.direction)
offset = Plane.Offset(byOriginNormal, code_block.offset)
visible = Geometry.Visible(offset)
