# Dynamo graph Plane.UsingAllConstructorsAndMethods.dyn (Dynamo 1.0.1.1743)

code_block = CodeBlock()
# ---------- code_block.designscript (5 lines) ----------
direction = Vector.ByCoordinates(0,0,1);
length = 10;
dist = 10;
direction1 = Vector.ByCoordinates(1,0,0);
Point.ByCoordinates(0,0,0);
# ----------------------------------------
byStartPointDirectionLength = Line.ByStartPointDirectionLength(startPoint=code_block.out4, direction=code_block.direction, length=code_block.length)
extrude = Curve.Extrude(curve=byStartPointDirectionLength, distance=code_block.dist)
code_block_2 = CodeBlock { 0.5; }
pointAtParameter = Surface.PointAtParameter(surface=extrude, u=code_block_2, v=code_block_2)
