# Dynamo graph Point.AtParameter.Surface.dyn (Dynamo 0.6.3.39524)

code_block = CodeBlock()
# ---------- code_block.designscript (5 lines) ----------
direction = Vector.ByCoordinates(0,0,1);
length = 10;
dist = 10;
direction1 = Vector.ByCoordinates(1,0,0);
Point.ByCoordinates(0,0,0);
# ----------------------------------------
byStartPointDirectionLength = Line.ByStartPointDirectionLength(code_block.out4, code_block.direction, code_block.length)
extrude = Curve.Extrude(byStartPointDirectionLength, code_block.dist, code_block.direction1)
code_block_2 = CodeBlock { 0.5; }
pointAtParameter = Surface.PointAtParameter(extrude, code_block_2, code_block_2)
