# Dynamo graph Point.ByShpericalCoordinates.Simple.dyn (Dynamo 0.6.3.33167)

WCS = CoordinateSystem.WCS()
code_block = CodeBlock { 1; 0..180..10; 45; }
bySphericalCoordinates = Point.BySphericalCoordinates(WCS, code_block.out0, code_block.out1, code_block.out1)
