# Dynamo graph Point.Project.OnCurve.Direction.dyn (Dynamo 0.6.3.33167)

code_block = CodeBlock()
# ---------- code_block.designscript (5 lines) ----------
Point.ByCoordinates(0,0,0);
Point.ByCoordinates(5,0,5);
Point.ByCoordinates(10,0,0);
Point.ByCoordinates(2,0,0);
Vector.ByCoordinates(1,0,0);
# ----------------------------------------
byPointsOnCurve = Arc.ByPointsOnCurve(code_block.out0, code_block.out1, code_block.out2)
project = Point.Project(code_block.out3, byPointsOnCurve)
project_2 = Point.Project(code_block.out3, byPointsOnCurve, code_block.out4)
