# Dynamo graph Point.Project.OnPlane.Direction.dyn (Dynamo 1.0.1.1743)

code_block = CodeBlock { Point.ByCoordinates(2,2,0); Point.ByCoordinates(0,0,0); Vector.ByCoordinates(1,0,0); }
byOriginNormal = Plane.ByOriginNormal(origin=code_block.out1, normal=code_block.out2)
project = Point.Project(code_block.out0, byOriginNormal)
project_2 = Point.Project(code_block.out0, byOriginNormal, code_block.out2)
