# Dynamo graph Point.Project.OnSolid.Direction.dyn (Dynamo 1.0.1.1743)

code_block = CodeBlock { Point.ByCoordinates(5,0,0); }
WCS = CoordinateSystem.WCS()
code_block_2 = CodeBlock { 5; }
byLengths = Cuboid.ByLengths(width=WCS, length=code_block_2, height=code_block_2)
project = Point.Project(code_block, byLengths)
code_block_3 = CodeBlock { Vector.ByCoordinates(-1,0,0); }
project_2 = Point.Project(code_block, byLengths, code_block_3)
byStartPointDirectionLength = Line.ByStartPointDirectionLength(startPoint=code_block, direction=code_block_3, length=code_block_2)
