# Dynamo graph Point.Project.OnSurface.Direction.dyn (Dynamo 1.0.1.1743)

WCS = CoordinateSystem.WCS()
XAxis = CoordinateSystem.XAxis(WCS)
code_block = CodeBlock { Point.ByCoordinates(3,0,10); Vector.ByCoordinates(0,0,-1); }
origin = CoordinateSystem.Origin(WCS)
code_block_2 = CodeBlock { 3; }
byCenterPointRadius = Circle.ByCenterPointRadius(centerPoint=origin, radius=code_block_2)
code_block_3 = CodeBlock { 10; 0; 6; }
translate = Geometry.Translate(geometry=origin, xTranslation=code_block_3.out0, yTranslation=code_block_3.out1, zTranslation=code_block_3.out1)
byCenterPointRadius_2 = Circle.ByCenterPointRadius(centerPoint=translate, radius=code_block_3.out2)
code_block_4 = CodeBlock(cs1=byCenterPointRadius, cs2=byCenterPointRadius_2) { crossSections = {cs1,cs2}; }
fromCrossSections = LoftedSurface.FromCrossSections(code_block_4)
project = Point.Project(code_block.out0, fromCrossSections)
project_2 = Point.Project(code_block.out0, fromCrossSections, code_block.out1)
