# Dynamo graph Point.SortByDistance.Simple.dyn (Dynamo 0.6.3.33167)

code_block = CodeBlock { Point.ByCoordinates(10,68,0); }
code_block_2 = CodeBlock()
# ---------- code_block_2.designscript (18 lines) ----------
WCS = CoordinateSystem.Identity();
p1 = WCS.Origin;
    p2 = p1.Translate(10, 0, 10);
    line = Line.ByStartPointEndPoint(p1, p2);
    arc = Arc.ByCenterPointRadiusAngle(p1.Translate(0, 10, 0), 3, 90, 245,
                                       Vector.ByCoordinates(0, 0, 1));
    pspline = p1.Translate(0, 20, 0);
    ptsArray = { pspline, pspline.Translate(5, 3, 0), pspline.Translate(9, 6, 0),
                 pspline.Translate(2, 10, 0) };
    spline = NurbsCurve.ByPoints(ptsArray);
    psplineclosed = p1.Translate(0, 40, 0);
    ptsArray1 = { psplineclosed, psplineclosed.Translate(5, 3, 0),
                  psplineclosed.Translate(9, 6, 0), psplineclosed.Translate(2, 10, 0) };
    splineClosed = NurbsCurve.ByPoints(ptsArray1, true);
    circle = Circle.ByCenterPointRadius(p1.Translate(0, 60, 0), 10,
                                        Vector.ByCoordinates(0, 1, 0));

curves = { line, arc, spline, splineClosed, circle };
# ----------------------------------------
sortByDistance = Point.SortByDistance(code_block, code_block_2.curves)
