# Dynamo graph Polygon.ByVertices.Simple.dyn (Dynamo 0.6.3.33167)

code_block = CodeBlock()
# ---------- code_block.designscript (4 lines) ----------
firstPoint  = Point.ByCoordinates(0, 0, 0);
secondPoint = Point.ByCoordinates(0, 10, 0);
thirdPoint  = Point.ByCoordinates(5, 5, 0);
{firstPoint , secondPoint,thirdPoint};
# ----------------------------------------
byPoints = Polygon.ByPoints(code_block.out3)
vertices = Polygon.Vertices(byPoints)
normal = Polygon.Normal(byPoints)
edges = Polygon.Edges(byPoints)
plane = Polygon.Plane(byPoints)
