# Dynamo graph Polygon.Trim.Simple.dyn (Dynamo 0.6.3.33167)

code_block = CodeBlock()
# ---------- code_block.designscript (4 lines) ----------
firstPoint  = Point.ByCoordinates(0, 0, 0);
secondPoint = Point.ByCoordinates(0, 10, 0);
thirdPoint  = Point.ByCoordinates(5, 5, 0);
{firstPoint , secondPoint,thirdPoint};
# ----------------------------------------
byPoints = Polygon.ByPoints(code_block.out3)
code_block_2 = CodeBlock()
# ---------- code_block_2.designscript (4 lines) ----------
WCS  = CoordinateSystem.Identity();
plane1          = Plane.ByOriginNormal(Point.ByCoordinates(0,5,0), WCS.YAxis);
plane2          = Plane.ByOriginNormal(Point.ByCoordinates(2.5,5,0), WCS.XAxis);
arrayOfPlanes = {plane1, plane2};
# ----------------------------------------
code_block_3 = CodeBlock { Point.ByCoordinates(2,3,0); }
trim = Polygon.Trim(byPoints, code_block_2.arrayOfPlanes, code_block_3)
