# Dynamo graph Solid.EdgePropertyCheck.dyn (Dynamo 0.6.3.33767)

WCS = CoordinateSystem.WCS()
origin = CoordinateSystem.Origin(WCS)
code_block = CodeBlock { 5; }
translate = Geometry.Translate(origin, code_block, code_block, code_block)
code_block_2 = CodeBlock { 2; }
byCenterPointRadius = Sphere.ByCenterPointRadius(translate, code_block_2)
edges = Solid.Edges(byCenterPointRadius)
WCS_2 = CoordinateSystem.WCS()
code_block_3 = CodeBlock { 10; 3; 20; }
byLengths = Cuboid.ByLengths(WCS_2, code_block_3.out0, code_block_3.out0, code_block_3.out0)
edges_2 = Solid.Edges(byLengths)
byRadiusHeight = Cylinder.ByRadiusHeight(WCS_2, code_block_3.out1, code_block_3.out2)
edges_3 = Solid.Edges(byRadiusHeight)
