# Dynamo graph Solid.IntersectDifference.dyn (Dynamo 1.0.1.1743)

code_block = CodeBlock()
# ---------- code_block.designscript (4 lines) ----------
WCS = CoordinateSystem.Identity();
//======Establish the context for creating Solid================
firstSolid = Cylinder.ByRadiusHeight(WCS, 50, 2.5);
secondSolid = Cuboid.ByLengths(WCS, 30, 30, 30);
# ----------------------------------------
difference = Solid.Difference(solid=code_block.firstSolid, other=code_block.secondSolid)
code_block_2 = CodeBlock { 100; 0; -100; }
translate = Geometry.Translate(geometry=difference, xTranslation=code_block_2.out0, yTranslation=code_block_2.out1, zTranslation=code_block_2.out1)
intersect = Solid.Intersect(code_block.firstSolid)
translate_2 = Geometry.Translate(geometry=intersect, xTranslation=code_block_2.out2, yTranslation=code_block_2.out1, zTranslation=code_block_2.out1)
