# Dynamo graph Solid.Revolve.AxisPointDirection.Simple.dyn (Dynamo 1.0.1.1743)

code_block = CodeBlock { t_5 = 0; t_6 = 10; t_1 = 32; t_2 = 20; t_3 = 1; t_4 = 4; }
byCoordinates = Vector.ByCoordinates(x=code_block.t_5, y=code_block.t_3, z=code_block.t_3)
byCoordinates_2 = Point.ByCoordinates(x=code_block.t_1, y=code_block.t_2, z=code_block.t_6)
byCenterPointRadius = Circle.ByCenterPointRadius(centerPoint=byCoordinates_2, radius=code_block.t_4)
byCoordinates_3 = Point.ByCoordinates(x=code_block.t_5, y=code_block.t_5, z=code_block.t_5)
byCoordinates_4 = Vector.ByCoordinates(x=code_block.t_6, y=code_block.t_6, z=code_block.t_6)
revolve = Solid.Revolve(byCenterPointRadius, byCoordinates_3, byCoordinates_4)
edges = Solid.Edges(revolve)
