# Dynamo graph Solid.SelectTrim.UsingArrayOfSolids.dyn (Dynamo 0.6.3.27769)

code_block = CodeBlock()
# ---------- code_block.designscript (8 lines) ----------
WCS = CoordinateSystem.Identity();
csForCubes = CoordinateSystem.ByOriginVectors(Point.ByCartesianCoordinates(WCS, (0..50..#3)<1>, 0, (0..20..#3)<2>),
Vector.ByCoordinates(1, 0, 0), Vector.ByCoordinates(0, 0, 1));
cubes = Cuboid.ByLengths(csForCubes, 12, 5, 5);
solid1 = Cylinder.ByRadiusHeight(WCS.Translate(10, -2.5, 10).Rotate (90, WCS.XAxis), 15, 20);
solid2   = Cylinder.ByRadiusHeight(WCS.Translate(40, -2.5, 10).Rotate (90, WCS.XAxis), 15, 20);
arrayOfSolids   = { solid1, solid2 };
false;
# ----------------------------------------
selectTrim = Solid.SelectTrim(code_block.cubes, code_block.arrayOfSolids, code_block.out6)
