# Dynamo graph Solid.SeparateSolid.Simple.dyn (Dynamo 0.6.3.27769)

WCS = CoordinateSystem.WCS()
code_block = CodeBlock { 10; 20; 3; }
byRadiusHeight = Cylinder.ByRadiusHeight(WCS, code_block.out2, code_block.out1)
byLengths = Cuboid.ByLengths(WCS, code_block.out0, code_block.out0, code_block.out0)
union = Solid.Union(byRadiusHeight, byLengths)
separateSolid = Solid.SeparateSolid(union)
