# Dynamo graph Solid.ShellPropertyCheck.dyn (Dynamo 1.0.1.1743)

WCS = CoordinateSystem.WCS()
code_block = CodeBlock { 10; 3; 20; }
byRadiusHeight = Cylinder.ByRadiusHeight(WCS, code_block.out1, code_block.out2)
shells = Solid.Shells(byRadiusHeight)
WCS_2 = CoordinateSystem.WCS()
origin = CoordinateSystem.Origin(WCS_2)
code_block_2 = CodeBlock { 5; }
translate = Geometry.Translate(geometry=origin, xTranslation=code_block_2, yTranslation=code_block_2, zTranslation=code_block_2)
code_block_3 = CodeBlock { 2; }
byCenterPointRadius = Sphere.ByCenterPointRadius(centerPoint=translate, radius=code_block_3)
shells_2 = Solid.Shells(byCenterPointRadius)
byLengths = Cuboid.ByLengths(width=WCS, length=code_block.out0, height=code_block.out0)
shells_3 = Solid.Shells(byLengths)
