# Dynamo graph Solid.Sweep.Simple.dyn (Dynamo 1.0.1.1743)

WCS = CoordinateSystem.WCS()
origin = CoordinateSystem.Origin(WCS)
code_block = CodeBlock { 2; }
byCenterPointRadius = Circle.ByCenterPointRadius(centerPoint=origin, radius=code_block)
code_block_2 = CodeBlock(profile=byCenterPointRadius)
# ---------- code_block_2.designscript (8 lines) ----------
arrayOfPoints   =
{
    profile.CenterPoint,
    profile.CenterPoint.Translate(12, 14, 13),
    profile.CenterPoint.Translate(24, 26, 27),
    Point.ByCoordinates(40, 40, 40)
};
path = NurbsCurve.ByPoints(arrayOfPoints);
# ----------------------------------------
sweep = Solid.Sweep(byCenterPointRadius, code_block_2.path)
sweep_2 = Surface.Sweep(byCenterPointRadius, code_block_2.path)
ZAxis = CoordinateSystem.ZAxis(WCS)
