# Dynamo graph Solid.Trim.ArrayOfPlanes.Simple.dyn (Dynamo 1.0.1.1743)

code_block = CodeBlock { 5; -3; }
byCoordinates = Point.ByCoordinates(x=code_block.out0, y=code_block.out1, z=code_block.out0)
WCS = CoordinateSystem.WCS()
code_block_2 = CodeBlock { 3; 10; }
byRadiusHeight = Cylinder.ByRadiusHeight(WCS, code_block_2.out0, code_block_2.out1)
code_block_3 = CodeBlock { 0; 2; }
byCoordinates_2 = Point.ByCoordinates(x=code_block_3.out0, y=code_block_3.out1, z=code_block_3.out0)
XAxis = CoordinateSystem.XAxis(WCS)
byOriginNormal = Plane.ByOriginNormal(origin=byCoordinates_2, normal=XAxis)
byCoordinates_3 = Point.ByCoordinates(x=code_block_3.out0, y=code_block_3.out0, z=code_block_3.out1)
YAxis = CoordinateSystem.YAxis(WCS)
byOriginNormal_2 = Plane.ByOriginNormal(origin=byCoordinates_3, normal=YAxis)
byCoordinates_4 = Point.ByCoordinates(x=code_block_3.out1, y=code_block_3.out0, z=code_block_3.out0)
ZAxis = CoordinateSystem.ZAxis(WCS)
byOriginNormal_3 = Plane.ByOriginNormal(origin=byCoordinates_4, normal=ZAxis)
code_block_4 = CodeBlock(plane1=byOriginNormal, plane2=byOriginNormal_2, plane3=byOriginNormal_3) { planes = {plane1, plane2, plane3}; }
# note: Trimming using array of Planes.
trim = Solid.Trim(byRadiusHeight, code_block_4)
# note: Trimming using Single plane
trim_2 = Solid.Trim(byRadiusHeight, byOriginNormal)
