# Dynamo graph Solid.Trim.ArrayOfSurfaces.Simple.dyn (Dynamo 0.6.3.27769)

code_block = CodeBlock()
# ---------- code_block.designscript (15 lines) ----------
WCS = CoordinateSystem.Identity();
cs = CoordinateSystem.ByThreePoints(Point.ByCoordinates(0, 0, 0),
 Point.ByCoordinates(0, 1, 0), Point.ByCoordinates(1, 0, 0));
cylinder = Cylinder.ByRadiusHeight(cs, 2, 10);
cone = Cone.ByRadiusHeight(cs.Translate(10, 0, 0), 1, 2, 10);
sphere = Sphere.ByCenterPointRadius(Point.ByCoordinates(20, 0, 0), 2);
cuboid = Cuboid.ByLengths(cs.Translate(30, 0, 0), 4, 4, 4);
arrayOfSolids = { cylinder, cone, sphere, cuboid };
surface1 = Line.ByStartPointEndPoint(Point.ByCoordinates(-5, -7.5, 0),
Point.ByCoordinates(50, -7.5, 0)).Extrude(15, Vector.ByCoordinates(0, 1, 0));
surface2 = Line.ByStartPointEndPoint(Point.ByCoordinates(-5, 0, -7),
Point.ByCoordinates(50, 0, -7)).Extrude(15, Vector.ByCoordinates(0, 0, 1));
arrayOfSurface      = { surface1, surface2 };
pickPoint           = Point.ByCoordinates(0, -2, 2);
anotherPickPoint    = Point.ByCoordinates(0, 2, -2);
# ----------------------------------------
trim = Solid.Trim(code_block.cylinder, code_block.arrayOfSurface, code_block.anotherPickPoint)
