# Dynamo graph Solid.Union.ArrayOfSolids.Simple.dyn (Dynamo 1.0.1.1743)

code_block = CodeBlock()
# ---------- code_block.designscript (13 lines) ----------
WCS = CoordinateSystem.Identity();

//======Establish the context for creating Solid================
firstSolid      = Cylinder.ByRadiusHeight(WCS.Translate
                                        (15, 15, 0), 2.5, 50);
ArrayOfSolids   =
{
    firstSolid,
    firstSolid.Translate(-30, 0, 0),
    firstSolid.Translate(-30, -30, 0),
    firstSolid.Translate(0, -30, 0)
};
secondSolid     = Cuboid.ByLengths(WCS, 30, 30, 30);
# ----------------------------------------
# note: Input ArrayOfSolids, Union failed.
union = Solid.Union(code_block.secondSolid, code_block.ArrayOfSolids)
# note: Input single solid, Union is working.
union_2 = Solid.Union(code_block.firstSolid, code_block.secondSolid)
