# Dynamo graph Solid.Union.NonManifolSolid.Cells.dyn (Dynamo 1.0.1.1743)

code_block = CodeBlock { false; }
WCS = CoordinateSystem.WCS()
code_block_2 = CodeBlock { 10; 5; }
byLengths = Cuboid.ByLengths(width=WCS, length=code_block_2.out0, height=code_block_2.out0)
translate = Geometry.Translate(geometry=WCS, xTranslation=code_block_2.out1, yTranslation=code_block_2.out1, zTranslation=code_block_2.out1)
byLengths_2 = Cuboid.ByLengths(width=translate, length=code_block_2.out0, height=code_block_2.out0)
union = Solid.Union(byLengths, byLengths_2)
cells = NonManifoldSolid.Cells(union)
