# Dynamo graph Solid.Union.NonManifold.Simple.dyn (Dynamo 2.0.0.4093)

code_block = CodeBlock()
# ---------- code_block.designscript (10 lines) ----------
WCS = CoordinateSystem.Identity();
firstSolid = Cylinder.ByRadiusHeight(CoordinateSystem.Translate(WCS, 15, 15, 0), 2.5, 50);
ArrayOfSolids   =
{
    firstSolid,
    Solid.Translate(firstSolid,-30, 0, 0),
    Solid.Translate(firstSolid,-30, -30, 0),
    Solid.Translate(firstSolid,0, -30, 0)
};
secondSolid     = Cuboid.ByLengths(WCS, 30, 30, 30);
# ----------------------------------------
union = Solid.Union(code_block.secondSolid, code_block.ArrayOfSolids)
code_block_2 = CodeBlock { 50; }
translate = Geometry.Translate(geometry=union, xTranslation=code_block_2, yTranslation=code_block_2, zTranslation=code_block_2)
