# Dynamo graph Solid.Union.Simple.dyn (Dynamo 0.6.3.27769)

WCS = CoordinateSystem.WCS()
code_block = CodeBlock { 10; 20; 3; }
byRadiusHeight = Cylinder.ByRadiusHeight(WCS, code_block.out2, code_block.out1)
byLengths = Cuboid.ByLengths(WCS, code_block.out0, code_block.out0, code_block.out0)
code_block_2 = CodeBlock(solid1=byRadiusHeight, solid2=byLengths) { solids1 = {solid1,solid2}; }
unionAll = Solid.UnionAll(code_block_2)
