# Dynamo graph Solid.UnionAll.Simple.dyn (Dynamo 1.0.1.1743)

WCS = CoordinateSystem.WCS()
code_block = CodeBlock { 10; 20; 3; }
byRadiusHeight = Cylinder.ByRadiusHeight(WCS, code_block.out2, code_block.out1)
byLengths = Cuboid.ByLengths(width=WCS, length=code_block.out0, height=code_block.out0)
code_block_2 = CodeBlock(solid1=byRadiusHeight, solid2=byLengths) { solids1 = {solid1,solid2}; }
unionAll = Solid.UnionAll(code_block_2)
