# Dynamo graph Solid.VerticesPropertyCheck.dyn (Dynamo 1.0.1.1743)

code_block = CodeBlock { Point.ByCoordinates(0,0,0); 10; }
byCenterPointRadius = Sphere.ByCenterPointRadius(centerPoint=code_block.out0, radius=code_block.out1)
vertices = Solid.Vertices(byCenterPointRadius)
WCS = CoordinateSystem.WCS()
code_block_2 = CodeBlock { 10; 2; }
byRadiusHeight = Cylinder.ByRadiusHeight(WCS, code_block_2.out1, code_block_2.out0)
vertices_2 = Solid.Vertices(byRadiusHeight)
byLengths = Cuboid.ByLengths(width=WCS, length=code_block_2.out0, height=code_block_2.out0)
vertices_3 = Solid.Vertices(byLengths)
