# Dynamo graph Surface.LoftFromCrossSections.Simple.dyn (Dynamo 1.0.1.1743)

code_block = CodeBlock { 0; 5; rad1 =3; Vector.ByCoordinates(1,0,0); 10; rad2 = 6; param = 0.5; 1; }
byCoordinates = Point.ByCoordinates(x=code_block.out0, y=code_block.out0, z=code_block.out1)
byCenterPointRadius = Circle.ByCenterPointRadius(centerPoint=byCoordinates, radius=code_block.rad1)
byCoordinates_2 = Point.ByCoordinates(x=code_block.out4, y=code_block.out0, z=code_block.out1)
byCenterPointRadius_2 = Circle.ByCenterPointRadius(centerPoint=byCoordinates_2, radius=code_block.rad2)
code_block_2 = CodeBlock(cros1=byCenterPointRadius, cross2=byCenterPointRadius_2) { corss = {cros1, cross2}; }
pointAtParameter = Curve.PointAtParameter(curve=byCenterPointRadius, param=code_block.param)
pointAtParameter_2 = Curve.PointAtParameter(curve=byCenterPointRadius_2, param=code_block.param)
byStartPointEndPoint = Line.ByStartPointEndPoint(startPoint=pointAtParameter, endPoint=pointAtParameter_2)
loftFromCrossSectionsGuides = Surface.LoftFromCrossSectionsGuides(code_block_2, byStartPointEndPoint)
loftFromCrossSections = Surface.LoftFromCrossSections(code_block_2)
