# Dynamo graph Surface.ParameterAtPoint.Simple.dyn (Dynamo 0.6.3.27769)

code_block = CodeBlock()
# ---------- code_block.designscript (9 lines) ----------
WCS = CoordinateSystem.Identity();
points      = Point.ByCoordinates(4, 0, 0..7); 
points[1]   = points[1].Translate(-1, 0, 0); 
points[5]   = points[5].Translate(1, 0, 0); 
curve       = NurbsCurve.ByPoints(points); 
axisOrigin  = Point.ByCoordinates(0, 0, 0); 
axis        = Vector.ByCoordinates(0, 0, 1); 
surface     = Surface.Revolve(curve, axisOrigin, axis, 0, 360);
point       = surface.PointAtParameter({ 0.25, 0.5, 0.75 }, 0.5);
# ----------------------------------------
parameterAtPoint = Surface.ParameterAtPoint(code_block.axisOrigin, code_block.axis)
