# Dynamo graph Surface.SelectTrim.UsingArrayOfSolids.dyn (Dynamo 1.0.1.1743)

code_block = CodeBlock { Vector.ByCoordinates(0,1,0); }
code_block_2 = CodeBlock { 0..5..0.5; 0; 10; }
byCoordinates = Point.ByCoordinates(x=code_block_2.out1, y=code_block_2.out1, z=code_block_2.out1)
byCoordinates_2 = Point.ByCoordinates(x=code_block_2.out2, y=code_block_2.out1, z=code_block_2.out1)
byStartPointEndPoint = Line.ByStartPointEndPoint(startPoint=byCoordinates, endPoint=byCoordinates_2)
extrude = Curve.Extrude(curve=byStartPointEndPoint, distance=code_block_2.out2)
translate = Geometry.Translate(geometry=extrude, xTranslation=code_block_2.out1, yTranslation=code_block_2.out1, zTranslation=code_block_2.out0)
WCS = CoordinateSystem.WCS()
code_block_3 = CodeBlock(WCS)
# ---------- code_block_3.designscript (2 lines) ----------
trimmingSolid   = Cylinder.ByRadiusHeight(WCS.Translate
                                             (3.75..6..#2, 3.75..6..#2, 2.5), 2, 7);
# ----------------------------------------
code_block_4 = CodeBlock { true; false; }
selectTrim = Surface.SelectTrim(translate, code_block_3, code_block_4.out1)
