# Dynamo graph Surface.Split.UsingPlanes.Simple.dyn (Dynamo 0.6.3.27769)

code_block = CodeBlock()
# ---------- code_block.designscript (9 lines) ----------
WCS = CoordinateSystem.Identity();
points          = Point.ByCoordinates(4, 0, 0..7); 
points[1]       = points[1].Translate(-1, 0, 0); 
points[5]       = points[5].Translate(1, 0, 0); 
curve           = NurbsCurve.ByPoints(points); 
axisOrigin      = Point.ByCoordinates(0, 0, 0); 
axis            = Vector.ByCoordinates(0, 0, 1); 
surfacetoSplit  = Surface.Revolve(curve, axisOrigin, axis, 10, 350);
splitting       = Plane.ByOriginNormal(Point.ByCoordinates(0, 2, 4), WCS.XAxis);
# ----------------------------------------
split = Surface.Split(code_block.axisOrigin, code_block.axis)
