# Dynamo graph Surface.Sweep.ProfilePath.dyn (Dynamo 0.6.3.27769)

WCS = CoordinateSystem.WCS()
code_block = CodeBlock(WCS=WCS)
# ---------- code_block.designscript (10 lines) ----------
profile = Circle.ByCenterPointRadius(Point.ByCartesianCoordinates
                                    (WCS, 0, 0, 0), 2, WCS.ZAxis);
arrayOfPoints =
{
        profile.CenterPoint,
        profile.CenterPoint.Translate(12, 14, 30),
        profile.CenterPoint.Translate(24, 26, 10),
        profile.CenterPoint.Translate(34, 36, 40)
};
path = NurbsCurve.ByPoints(arrayOfPoints);
# ----------------------------------------
sweep = Surface.Sweep(code_block.profile, code_block.path)
byProfilePath = SweptSurface.ByProfilePath(code_block.profile, code_block.path)
sweepAsSurface = Curve.SweepAsSurface(code_block.profile, code_block.path)
