# Dynamo graph Surface.Thicken.Simple.dyn (Dynamo 0.6.3.27769)

WCS = CoordinateSystem.WCS()
origin = CoordinateSystem.Origin(WCS)
XAxis = CoordinateSystem.XAxis(WCS)
code_block = CodeBlock { 10; 2; }
byStartPointDirectionLength = Line.ByStartPointDirectionLength(origin, XAxis, code_block.out0)
YAxis = CoordinateSystem.YAxis(WCS)
extrude = Curve.Extrude(byStartPointDirectionLength, code_block.out0, YAxis)
code_block_2 = CodeBlock { true; }
thicken = Surface.Thicken(extrude, code_block.out1, code_block_2)
