# Dynamo graph Surface.Trim.ArrayOfCurves.dyn (Dynamo 1.0.1.1743)

WCS = CoordinateSystem.WCS()
YAxis = CoordinateSystem.YAxis(WCS)
code_block = CodeBlock { true; }
code_block_2 = CodeBlock { true; false; }
origin = CoordinateSystem.Origin(WCS)
XAxis = CoordinateSystem.XAxis(WCS)
code_block_3 = CodeBlock { 10; 2; }
byStartPointDirectionLength = Line.ByStartPointDirectionLength(startPoint=origin, direction=XAxis, length=code_block_3.out0)
extrude = Curve.Extrude(curve=byStartPointDirectionLength, distance=code_block_3.out0)
code_block_4 = CodeBlock()
# ---------- code_block_4.designscript (5 lines) ----------
curve1 = Circle.ByCenterPointRadius(Point.ByCoordinates(3.75, 3.75, 0), 2);
curve2 = Circle.ByCenterPointRadius(Point.ByCoordinates(6, 6, 0), 2);
arrayOfCurves   = { curve1, curve2 };
selectPoint1 = Point.ByCoordinates(2, 0, 0);
selectPoint2 = Point.ByCoordinates(5, 5, 0);
# ----------------------------------------
trim = Surface.Trim(extrude, code_block_4.arrayOfCurves, code_block_4.selectPoint1)
