# Dynamo graph ArrayOfLines_WithSliceNode.dyn (Dynamo 1.0.1.1743)

number = DoubleInput(0..10..1)
point = Point3DNode(number, lacing=Longest)
line_libg = LineNode(point, lacing=Longest)
number_2 = DoubleInput(3)
add = number_2 + number_2
slice = List.Slice(line_libg, number_2, add)
number_3 = DoubleInput(1)
getItemAtIndex = List.GetItemAtIndex(list=slice, index=number_3)
watch_3d = Watch3D(getItemAtIndex)
number_4 = DoubleInput(0)
point_2 = Point3DNode(number, lacing=Longest)
number_5 = DoubleInput(10)
