# Dynamo graph BSplineCurveTest.dyn (Dynamo 0.7.0.16336)

code_block = CodeBlock { 0..5; }
code_block_2 = CodeBlock { 0; }
code_block_3 = CodeBlock(a=code_block, b=code_block_2) { Point.ByCoordinates(a<1>,a<2>,b); }
number = DoubleInput(1)
byControlPoints = NurbsCurve.ByControlPoints(code_block_3, number)
watch_3d = Watch3D(byControlPoints)
