# Dynamo graph BSplineCurve_AllPointsAreArSamePosition.dyn (Dynamo 0.6.3.29004)

number = DoubleInput(0)
point = Point3DNode(number, number, number, lacing=Longest)
list = NewList(index0=point, index1=point, index2=point, index3=point)
BSplineCurve = BSplineCurveNode(list, lacing=Longest)
