# Dynamo graph CircleTest.dyn (Dynamo 1.0.1.1743)

number = DoubleInput(0)
vector = VectorNode(number, lacing=Longest)
number_2 = DoubleInput(1)
number_slider = DoubleSlider(50, range=0..100 step 0.1)
point = Point3DNode(number, lacing=Longest)
circle_libg = CircleNode(point, lacing=Longest)
watch_3d = Watch3D(circle_libg)
