# Dynamo graph Circle_NegativeTest.dyn (Dynamo 0.7.0.23082)

number = DoubleInput(0)
point = Point3DNode(number, number, number, lacing=Longest)
number_2 = DoubleInput(1)
vector = VectorNode(number, number, number, lacing=Longest)
circleWithZeroVectorLength = CircleNode(point, number_2, vector, lacing=Longest)
watch_3d = Watch3D(circleWithZeroVectorLength)
number_3 = DoubleInput(5)
number_4 = DoubleInput(0)
point_2 = Point3DNode(number_3, number_4, number_4, lacing=Longest)
number_5 = DoubleInput(0)
number_6 = DoubleInput(1)
vector_2 = VectorNode(number_4, number_4, number_6, lacing=Longest)
circleWithRadiusZero = CircleNode(point_2, number_5, vector_2, lacing=Longest)
watch_3d_2 = Watch3D(circleWithRadiusZero)
