# Dynamo graph CuboidTest.dyn (Dynamo 0.6.3.25915)

number = DoubleInput(5)
number_2 = DoubleInput(0..100..#10)
number_3 = DoubleInput(0)
point = Point3DNode(number_2, number_3, number_3, lacing=Longest)
number_4 = DoubleInput(1)
vector = VectorNode(number_4, number_3, number_3, lacing=Longest)
vector_2 = VectorNode(number_3, number_4, number_3, lacing=Longest)
coordinateSystem = CoordinateSystemNode(point, vector, vector_2, lacing=Longest)
cuboid = CuboidNode(coordinateSystem, number, number, number, lacing=Longest)
get_from_list = GetFromList(number, cuboid)
