# Dynamo graph ExtrudCurveTest.dyn (Dynamo 1.0.1.1743)

PI = Math.PI()
number = DoubleInput(2)
mul = PI * number  # lacing=Longest
number_2 = DoubleInput(0.01..2..0.01)
mul_2 = mul * number_2  # lacing=Longest
radiansToDegrees = Math.RadiansToDegrees(mul_2)
sin = Math.Sin(radiansToDegrees, lacing=Longest)
number_3 = DoubleInput(1)
mul_3 = sin * number_3  # lacing=Longest
watch = Watch(mul_3)
number_4 = DoubleInput(0)
point = Point3DNode(mul_3, lacing=Longest)
number_5 = DoubleInput(0)
getItemAtIndex = List.GetItemAtIndex(list=point, index=number_5)
number_6 = DoubleInput(20)
getItemAtIndex_2 = List.GetItemAtIndex(list=point, index=number_6)
create_list = List.Create(getItemAtIndex, getItemAtIndex_2)
BSplineCurve = BSplineCurveNode(create_list, lacing=Longest)
watch_3d = Watch3D(BSplineCurve)
number_7 = DoubleInput(0)
vector = VectorNode(number_7, lacing=Longest)
number_8 = DoubleInput(1)
number_9 = DoubleInput(1)
extrude_curve = ExtrudeNode(BSplineCurve, lacing=Longest)
thicken_surface = ThickenSurfaceNode(extrude_curve, lacing=Longest)
