# Dynamo graph ExtrudeArrayOfClosedCurves.dyn (Dynamo 0.6.3.29004)

number = DoubleInput(0)
number_2 = DoubleInput(0..20..5)
point = Point3DNode(number_2, number, number, lacing=Longest)
number_3 = DoubleInput(2)
number_4 = DoubleInput(0)
number_5 = DoubleInput(1)
vector = VectorNode(number_4, number_4, number_5, lacing=Longest)
circle_libg = CircleNode(point, number_3, vector, lacing=Longest)
number_6 = DoubleInput(10)
extrude_curve = ExtrudeNode(circle_libg, vector, number_6, lacing=Longest)
get_from_list = GetFromList(number, extrude_curve)
