# Dynamo graph ExtrudeArrayOfOpenCurves.dyn (Dynamo 0.7.0.25915)

number = DoubleInput(1..2)
number_2 = DoubleInput(0)
point = Point3DNode(number, number, number_2, lacing=CrossProduct)
flatten_completely = FlattenList(point)
BSplineCurve = BSplineCurveNode(flatten_completely, lacing=Longest)
number_3 = DoubleInput(0)
number_4 = DoubleInput(1)
vector = VectorNode(number_3, number_3, number_4, lacing=Longest)
number_5 = DoubleInput(3)
extrude_curve = ExtrudeNode(BSplineCurve, vector, number_5, lacing=Longest)
watch_3d = Watch3D(extrude_curve)
