# Dynamo graph Intersect_CuboidAndCuboid.dyn (Dynamo 0.6.2.25053)

number = DoubleInput(0)
point = Point3DNode(number, number, number, lacing=Longest)
number_2 = DoubleInput(1)
number_3 = DoubleInput(0)
vector = VectorNode(number_2, number_3, number_3, lacing=Longest)
number_4 = DoubleInput(0)
number_5 = DoubleInput(1)
vector_2 = VectorNode(number_4, number_5, number_4, lacing=Longest)
coordinateSystem = CoordinateSystemNode(point, vector, vector_2, lacing=Longest)
number_6 = DoubleInput(4)
cuboid = CuboidNode(coordinateSystem, number_6, number_6, number_6, lacing=Longest)
number_7 = DoubleInput(2)
point_2 = Point3DNode(number_7, number_7, number_7, lacing=Longest)
number_8 = DoubleInput(1)
number_9 = DoubleInput(0)
vector_3 = VectorNode(number_8, number_9, number_9, lacing=Longest)
number_10 = DoubleInput(0)
number_11 = DoubleInput(1)
vector_4 = VectorNode(number_10, number_11, number_10, lacing=Longest)
coordinateSystem_2 = CoordinateSystemNode(point_2, vector_3, vector_4, lacing=Longest)
number_12 = DoubleInput(4)
cuboid_2 = CuboidNode(coordinateSystem_2, number_12, number_12, number_12, lacing=Longest)
intersect = IntersectNode(cuboid, cuboid_2, lacing=Longest)
number_13 = DoubleInput(0)
number_14 = DoubleInput(5)
vector_5 = VectorNode(number_13, number_13, number_14, lacing=Longest)
translate = TranslateNode(intersect, vector_5, lacing=Longest)
watch_3d = Watch3D(translate)
number_15 = DoubleInput(0)
