# Dynamo graph Intersect_SurfaceAndCuboid.dyn (Dynamo 0.6.2.25053)

number = DoubleInput(-3)
number_2 = DoubleInput(0)
point = Point3DNode(number, number_2, number_2, lacing=Longest)
number_3 = DoubleInput(3)
number_4 = DoubleInput(0)
point_2 = Point3DNode(number_3, number_4, number_4, lacing=Longest)
line_libg = LineNode(point, point_2, lacing=Longest)
number_5 = DoubleInput(0)
number_6 = DoubleInput(1)
vector = VectorNode(number_5, number_6, number_5, lacing=Longest)
number_7 = DoubleInput(4)
extrude_curve = ExtrudeNode(line_libg, vector, number_7, lacing=Longest)
number_8 = DoubleInput(0)
point_3 = Point3DNode(number_8, number_8, number_8, lacing=Longest)
number_9 = DoubleInput(1)
number_10 = DoubleInput(0)
vector_2 = VectorNode(number_9, number_10, number_10, lacing=Longest)
coordinateSystem = CoordinateSystemNode(point_3, vector_2, vector, lacing=Longest)
number_11 = DoubleInput(4)
cuboid = CuboidNode(coordinateSystem, number_11, number_11, number_11, lacing=Longest)
intersect = IntersectNode(extrude_curve, cuboid, lacing=Longest)
number_12 = DoubleInput(0)
number_13 = DoubleInput(5)
vector_3 = VectorNode(number_12, number_12, number_13, lacing=Longest)
translate = TranslateNode(intersect, vector_3, lacing=Longest)
