# Dynamo graph LineTest.dyn

number = DoubleInput(0)
point = Point3DNode(number, number, number, lacing=Longest)
number_2 = DoubleInput(10)
point_2 = Point3DNode(number_2, number, number, lacing=Longest)
line_libg = LineNode(point, point_2, lacing=Longest)
length_libg = LengthNode(line_libg, lacing=Longest)
