# Dynamo graph LoftUsingCircles.dyn (Dynamo 0.6.3.29004)

number = DoubleInput(0)
number_2 = DoubleInput(0)
point = Point3DNode(number, number_2, number_2, lacing=Longest)
number_slider = DoubleSliderInput(4.137, range=0..10)
formula = Formula("x*2", x=number_slider, lacing=Longest)
number_3 = DoubleInput(1)
number_4 = DoubleInput(0)
vector = VectorNode(number_3, number_4, number_4, lacing=Longest)
circle_libg = CircleNode(point, formula, vector, lacing=Longest)
number_5 = DoubleInput(15)
number_6 = DoubleInput(0)
point_2 = Point3DNode(number_5, number_6, number_6, lacing=Longest)
formula_2 = Formula("x*4", x=number_slider, lacing=Longest)
circle_libg_2 = CircleNode(point_2, formula_2, vector, lacing=Longest)
number_7 = DoubleInput(5)
number_8 = DoubleInput(0)
point_3 = Point3DNode(number_7, number_8, number_8, lacing=Longest)
formula_3 = Formula("x+0.5", x=number_slider, lacing=Longest)
circle_libg_3 = CircleNode(point_3, formula_3, vector, lacing=Longest)
number_9 = DoubleInput(20)
number_10 = DoubleInput(0)
point_4 = Point3DNode(number_9, number_10, number_10, lacing=Longest)
formula_4 = Formula("(x*4)/10", x=number_slider, lacing=Longest)
circle_libg_4 = CircleNode(point_4, formula_4, vector, lacing=Longest)
number_11 = DoubleInput(19)
number_12 = DoubleInput(0)
point_5 = Point3DNode(number_11, number_12, number_12, lacing=Longest)
formula_5 = Formula("x/2", x=number_slider, lacing=Longest)
circle_libg_5 = CircleNode(point_5, formula_5, vector, lacing=Longest)
list = NewList(index0=circle_libg, index1=circle_libg_2, index2=circle_libg_3, index3=circle_libg_4, index4=circle_libg_5)
loft = LoftNode(list, lacing=Longest)
number_13 = DoubleInput(0.009)
thicken_surface = ThickenSurfaceNode(loft, number_13, lacing=Longest)
