# Dynamo graph Loft_NegativeScenario.dyn (Dynamo 0.7.0.23082)

number = DoubleInput(0)
point = Point3DNode(number, number, number, lacing=Longest)
number_2 = DoubleInput(2)
number_3 = DoubleInput(0)
number_4 = DoubleInput(1)
vector = VectorNode(number_3, number_3, number_4, lacing=Longest)
circle_libg = CircleNode(point, number_2, vector, lacing=Longest)
number_5 = DoubleInput(10)
point_2 = Point3DNode(number, number, number_5, lacing=Longest)
line_libg = LineNode(point, point_2, lacing=Longest)
list = NewList(index0=circle_libg, index1=line_libg)
loft = LoftNode(list, lacing=Longest)
