# Dynamo graph PatchSurfaceTest.dyn (Dynamo 1.0.1.1743)

number = DoubleInput(1..2)
point = Point3DNode(number, lacing=Longest)
BSplineCurve = BSplineCurveNode(point, lacing=Longest)
number_2 = DoubleInput(1..2)
point_2 = Point3DNode(number_2, lacing=Longest)
BSplineCurve_2 = BSplineCurveNode(point_2, lacing=Longest)
create_list = List.Create(BSplineCurve, BSplineCurve_2)
patch = PatchNode(create_list, lacing=Longest)
number_3 = DoubleInput(0)
number_4 = DoubleInput(0)
number_5 = DoubleInput(2)
