# Dynamo graph PlaneTest.dyn (Dynamo 0.6.3.29004)

number = DoubleInput(0..10..2)
number_2 = DoubleInput(0)
point = Point3DNode(number, number_2, number_2, lacing=Longest)
number_3 = DoubleInput(1)
number_4 = DoubleInput(0)
vector = VectorNode(number_3, number_4, number_4, lacing=Longest)
plane_libg = PlaneNode(point, vector, lacing=Longest)
watch_3d = Watch3D(plane_libg)
watch = Watch(plane_libg)
get_from_list = GetFromList(number_3, plane_libg)
