# Dynamo graph Point2D_ArrayOfPoint.dyn (Dynamo 1.0.1.1743)

number = DoubleInput(1..10)
number_2 = DoubleInput(1..10)
point_2d = Point2DNode(number_2, lacing=Longest)
number_3 = DoubleInput(0)
getItemAtIndex = List.GetItemAtIndex(list=point_2d, index=number_3)
watch = Watch(getItemAtIndex)
