# Dynamo graph Point3DTest.dyn (Dynamo 0.6.3.25915)

number = DoubleInput(0)
pi = Pi()
point = Point3DNode(number, pi, pi, lacing=Longest)
point_x = PointXNode(point, lacing=Longest)
point_y = PointYNode(point, lacing=Longest)
point_z = PointZNode(point, lacing=Longest)
