# Dynamo graph PointAtDistanceTest.dyn (Dynamo 0.6.3.25915)

number = DoubleInput(0)
point = Point3DNode(number, number, number, lacing=Longest)
number_2 = DoubleInput(0)
number_3 = DoubleInput(3)
point_2 = Point3DNode(number_2, number_3, number_3, lacing=Longest)
number_4 = DoubleInput(0)
number_5 = DoubleInput(6)
number_6 = DoubleInput(-3)
point_3 = Point3DNode(number_4, number_5, number_6, lacing=Longest)
number_7 = DoubleInput(0)
number_8 = DoubleInput(9)
point_4 = Point3DNode(number_7, number_8, number_7, lacing=Longest)
list = NewList(index0=point, index1=point_2, index2=point_3, index3=point_4)
BSplineCurve = BSplineCurveNode(list, lacing=Longest)
watch_3d = Watch3D(BSplineCurve)
number_9 = DoubleInput(6)
number_10 = DoubleInput(10)
number_11 = DoubleInput(0)
vector = VectorNode(number_10, number_11, number_11, lacing=Longest)
translate = TranslateNode(BSplineCurve, vector, lacing=Longest)
length_libg = LengthNode(BSplineCurve, lacing=Longest)
number_12 = DoubleInput(0..x..#10, length_libg, lacing=Longest)
point_at_distance = PointAtDistanceNode(translate, number_12, lacing=Longest)
get_from_list = GetFromList(number_9, point_at_distance)
number_13 = DoubleInput(3)
point_at_distance_2 = PointAtDistanceNode(BSplineCurve, number_12, lacing=Longest)
get_from_list_2 = GetFromList(number_13, point_at_distance_2)
line_libg = LineNode(get_from_list, get_from_list_2, lacing=Longest)
watch_3d_2 = Watch3D(line_libg)
