# Dynamo graph PointAtParameter_SimpleTest.dyn (Dynamo 1.0.1.1743)

number = DoubleInput(0)
formula = Formula("270+30", lacing=Longest)
number_2 = DoubleInput(5)
range = Range(start=number, end=formula, step=number_2, lacing=Longest)
number_3 = DoubleInput(3)
mul = range * number_3  # lacing=Longest
formula_2 = Formula("x*0.017453", x=mul, lacing=Longest)
radiansToDegrees = Math.RadiansToDegrees(formula_2)
sin = Math.Sin(radiansToDegrees, lacing=Longest)
number_4 = DoubleInput(-5)
mul_2 = sin * number_4  # lacing=Longest
number_5 = DoubleInput(0)
number_6 = DoubleInput(0..1..#20)
point = Point3DNode(range, lacing=Longest)
BSplineCurve = BSplineCurveNode(point, lacing=Longest)
point_at_parameter = PointAtParameterNode(BSplineCurve, lacing=Longest)
number_7 = DoubleInput(18)
getItemAtIndex = List.GetItemAtIndex(list=point_at_parameter, index=number_7)
number_8 = DoubleInput(0)
getItemAtIndex_2 = List.GetItemAtIndex(list=point_at_parameter, index=number_8)
line_libg = LineNode(getItemAtIndex_2, lacing=Longest)
length_libg = LengthNode(line_libg, lacing=Longest)
