# Dynamo graph PointAtUVParameterTest.dyn (Dynamo 1.0.1.1743)

number = DoubleInput(0)
vector = VectorNode(number, lacing=Longest)
number_2 = DoubleInput(1)
number_3 = DoubleInput(0)
number_4 = DoubleInput(0)
vector_2 = VectorNode(number_4, lacing=Longest)
number_5 = DoubleInput(1)
number_6 = DoubleInput(0)
number_7 = DoubleInput(0)
vector_3 = VectorNode(number_7, lacing=Longest)
number_8 = DoubleInput(1)
number_slider = DoubleSlider(27.01, range=10..50 step 0.1)
number_9 = DoubleInput("0..1..#x*1.5", number_slider, lacing=Longest)
formula = Formula("x/1", x=number_slider, lacing=Longest)
formula_2 = Formula("x/2", x=number_slider, lacing=Longest)
formula_3 = Formula("x/4", x=number_slider, lacing=Longest)
formula_4 = Formula("-x/2", x=number_slider, lacing=Longest)
number_10 = DoubleInput(0)
vector_4 = VectorNode(number_10, lacing=Longest)
number_11 = DoubleInput(1)
number_12 = DoubleInput(0.1)
number_13 = DoubleInput(0)
point = Point3DNode(number_13, lacing=Longest)
circle_libg = CircleNode(point, lacing=Longest)
point_at_parameter = PointAtParameterNode(circle_libg, lacing=Longest)
number_14 = DoubleInput(0)
getItemAtIndex = List.GetItemAtIndex(list=point_at_parameter, index=number_14)
number_15 = DoubleInput(0)
point_2 = Point3DNode(number_15, lacing=Longest)
circle_libg_2 = CircleNode(point_2, lacing=Longest)
point_at_parameter_2 = PointAtParameterNode(circle_libg_2, lacing=Longest)
getItemAtIndex_2 = List.GetItemAtIndex(list=point_at_parameter_2, index=number_14)
number_16 = DoubleInput(0)
point_3 = Point3DNode(number_16, lacing=Longest)
circle_libg_3 = CircleNode(point_3, lacing=Longest)
point_at_parameter_3 = PointAtParameterNode(circle_libg_3, lacing=Longest)
getItemAtIndex_3 = List.GetItemAtIndex(list=point_at_parameter_3, index=number_14)
create_list = List.Create(getItemAtIndex, getItemAtIndex_2, getItemAtIndex_3)
BSplineCurve = BSplineCurveNode(create_list, lacing=Longest)
number_17 = DoubleInput(0)
point_4 = Point3DNode(number_17, lacing=Longest)
circle_libg_4 = CircleNode(point_4, lacing=Longest)
sweep_as_surface = SweepAsSurfaceNode(circle_libg_4, lacing=Longest)
watch_3d = Watch3D(sweep_as_surface)
watch = Watch(point_at_parameter)
number_18 = DoubleInput(0..1..#x, number_slider, lacing=Longest)
point_at_uv_parameter = PointAtUvParameterNode(sweep_as_surface, lacing=Longest)
BSplineCurve_2 = BSplineCurveNode(point_at_uv_parameter, lacing=Longest)
watch_3d_2 = Watch3D(BSplineCurve_2)
number_19 = DoubleInput(5)
getItemAtIndex_4 = List.GetItemAtIndex(list=point_at_uv_parameter, index=number_19)
