# Dynamo graph PointAtUVParameter_SimpleTest.dyn (Dynamo 0.6.3.25915)

number = DoubleInput(0)
number_2 = DoubleInput(0)
number_3 = DoubleInput(0)
point = Point3DNode(number_3, number_3, number_3, lacing=Longest)
number_4 = DoubleInput(0.1)
number_5 = DoubleInput(0)
number_6 = DoubleInput(1)
vector = VectorNode(number_5, number_5, number_6, lacing=Longest)
circle_libg = CircleNode(point, number_4, vector, lacing=Longest)
number_7 = DoubleInput(0)
number_8 = DoubleInput(0)
number_slider = DoubleSliderInput(10, range=10..50)
formula = Formula("-x/2", x=number_slider, lacing=Longest)
point_2 = Point3DNode(number_8, number_8, formula, lacing=Longest)
formula_2 = Formula("x/2", x=number_slider, lacing=Longest)
number_9 = DoubleInput(0)
number_10 = DoubleInput(1)
vector_2 = VectorNode(number_9, number_9, number_10, lacing=Longest)
circle_libg_2 = CircleNode(point_2, formula_2, vector_2, lacing=Longest)
number_11 = DoubleInput("0..1..#x*1.5", number_slider, lacing=Longest)
point_at_parameter = PointAtParameterNode(circle_libg_2, number_11, lacing=Longest)
get_from_list = GetFromList(number_7, point_at_parameter)
number_12 = DoubleInput(0)
point_3 = Point3DNode(number_12, number_12, number_12, lacing=Longest)
formula_3 = Formula("x/1", x=number_slider, lacing=Longest)
number_13 = DoubleInput(0)
number_14 = DoubleInput(1)
vector_3 = VectorNode(number_13, number_13, number_14, lacing=Longest)
circle_libg_3 = CircleNode(point_3, formula_3, vector_3, lacing=Longest)
point_at_parameter_2 = PointAtParameterNode(circle_libg_3, number_11, lacing=Longest)
get_from_list_2 = GetFromList(number_7, point_at_parameter_2)
number_15 = DoubleInput(0)
point_4 = Point3DNode(number_15, number_15, number_slider, lacing=Longest)
formula_4 = Formula("x/4", x=number_slider, lacing=Longest)
number_16 = DoubleInput(0)
number_17 = DoubleInput(1)
vector_4 = VectorNode(number_16, number_16, number_17, lacing=Longest)
circle_libg_4 = CircleNode(point_4, formula_4, vector_4, lacing=Longest)
point_at_parameter_3 = PointAtParameterNode(circle_libg_4, number_11, lacing=Longest)
get_from_list_3 = GetFromList(number_7, point_at_parameter_3)
list = NewList(index0=get_from_list, index1=get_from_list_2, index2=get_from_list_3)
BSplineCurve = BSplineCurveNode(list, lacing=Longest)
sweep_as_surface = SweepAsSurfaceNode(circle_libg, BSplineCurve, lacing=Longest)
watch_3d = Watch3D(sweep_as_surface)
number_18 = DoubleInput(0..1..#10)
point_at_uv_parameter = PointAtUvParameterNode(sweep_as_surface, number_18, number_18, lacing=Longest)
watch_3d_2 = Watch3D(point_at_uv_parameter)
number_19 = DoubleInput(1)
get_from_list_4 = GetFromList(number_19, point_at_uv_parameter)
number_20 = DoubleInput(9)
get_from_list_5 = GetFromList(number_20, point_at_uv_parameter)
line_libg = LineNode(get_from_list_4, get_from_list_5, lacing=Longest)
watch_3d_3 = Watch3D(line_libg)
length_libg = LengthNode(line_libg, lacing=Longest)
