# Dynamo graph Point_WithInvalidInputType.dyn (Dynamo 0.6.3.29004)

point = Point3DNode(lacing=Longest)
number = DoubleInput(1)
number_2 = DoubleInput(2)
point_2 = Point3DNode(point, number, number_2, lacing=Longest)
