# Dynamo graph PolygonTest.dyn (Dynamo 0.6.3.25915)

number = DoubleInput(0)
number_2 = DoubleInput(0)
number_3 = DoubleInput(0)
point = Point3DNode(number, number_2, number_3, lacing=Longest)
number_4 = DoubleInput(2)
number_5 = DoubleInput(-2)
number_6 = DoubleInput(10)
point_2 = Point3DNode(number_4, number_5, number_6, lacing=Longest)
number_7 = DoubleInput(5)
number_8 = DoubleInput(1)
number_9 = DoubleInput(8)
point_3 = Point3DNode(number_7, number_8, number_9, lacing=Longest)
number_10 = DoubleInput(5)
number_11 = DoubleInput(0)
number_12 = DoubleInput(2)
point_4 = Point3DNode(number_10, number_11, number_12, lacing=Longest)
list = NewList(index0=point, index1=point_2, index2=point_3, index3=point_4)
polygon = PolygonNode(list, lacing=Longest)
watch_3d = Watch3D(polygon)
