# Dynamo graph Polygon_AllPointsAreLinear.dyn (Dynamo 0.6.3.11786)

number = DoubleInput(0)
point = Point3DNode(number, number, number, lacing=Longest)
number_2 = DoubleInput(10)
point_2 = Point3DNode(number_2, number, number, lacing=Longest)
number_3 = DoubleInput(5)
point_3 = Point3DNode(number_3, number, number, lacing=Longest)
list = NewList(index0=point, index1=point_2, index2=point_3)
polygon = PolygonNode(list, lacing=Longest)
