# Dynamo graph SurfaceTest.dyn (Dynamo 0.6.3.25915)

number = DoubleInput(0)
number_2 = DoubleInput(0)
number_3 = DoubleInput(0)
point = Point3DNode(number_3, number_3, number_3, lacing=Longest)
number_slider = DoubleSliderInput(10, range=10..50)
formula = Formula("x/1", x=number_slider, lacing=Longest)
number_4 = DoubleInput(0)
number_5 = DoubleInput(1)
vector = VectorNode(number_4, number_4, number_5, lacing=Longest)
circle_libg = CircleNode(point, formula, vector, lacing=Longest)
number_6 = DoubleInput("0..1..#x*1.5", number_slider, lacing=Longest)
point_at_parameter = PointAtParameterNode(circle_libg, number_6, lacing=Longest)
number_7 = DoubleInput(0)
point_2 = Point3DNode(number_7, number_7, number_slider, lacing=Longest)
formula_2 = Formula("x/4", x=number_slider, lacing=Longest)
number_8 = DoubleInput(0)
number_9 = DoubleInput(1)
vector_2 = VectorNode(number_8, number_8, number_9, lacing=Longest)
circle_libg_2 = CircleNode(point_2, formula_2, vector_2, lacing=Longest)
point_at_parameter_2 = PointAtParameterNode(circle_libg_2, number_6, lacing=Longest)
line_libg = LineNode(point_at_parameter, point_at_parameter_2, lacing=Longest)
number_10 = DoubleInput(1)
number_11 = DoubleInput(0)
number_12 = DoubleInput(1)
vector_3 = VectorNode(number_11, number_11, number_12, lacing=Longest)
circle_libg_3 = CircleNode(point_at_parameter, number_10, vector_3, lacing=Longest)
sweep_as_surface = SweepAsSurfaceNode(line_libg, circle_libg_3, lacing=Longest)
number_13 = DoubleInput(0)
point_3 = Point3DNode(number_13, number_13, number_13, lacing=Longest)
number_14 = DoubleInput(2)
number_15 = DoubleInput(0)
formula_3 = Formula("-x/2", x=number_slider, lacing=Longest)
point_4 = Point3DNode(number_15, number_15, formula_3, lacing=Longest)
formula_4 = Formula("x/2", x=number_slider, lacing=Longest)
number_16 = DoubleInput(0)
number_17 = DoubleInput(1)
vector_4 = VectorNode(number_16, number_16, number_17, lacing=Longest)
circle_libg_4 = CircleNode(point_4, formula_4, vector_4, lacing=Longest)
point_at_parameter_3 = PointAtParameterNode(circle_libg_4, number_6, lacing=Longest)
line_libg_2 = LineNode(point_at_parameter, point_at_parameter_3, lacing=Longest)
sweep_as_surface_2 = SweepAsSurfaceNode(line_libg_2, circle_libg_3, lacing=Longest)
get_from_list = GetFromList(number_14, sweep_as_surface_2)
number_18 = DoubleInput(3)
get_from_list_2 = GetFromList(number_18, sweep_as_surface_2)
