# Dynamo graph SweeAsSurface_AnotherTest.dyn (Dynamo 0.7.0.25915)

number = DoubleInput(0)
number_2 = DoubleInput(5)
point = Point3DNode(number, number_2, number, lacing=Longest)
number_3 = DoubleInput(10)
point_2 = Point3DNode(number, number, number_3, lacing=Longest)
line_libg = LineNode(point, point_2, lacing=Longest)
number_4 = DoubleInput(0)
point_3 = Point3DNode(number_4, number_4, number_4, lacing=Longest)
number_5 = DoubleInput(1)
number_6 = DoubleInput(0)
number_7 = DoubleInput(1)
vector = VectorNode(number_6, number_6, number_7, lacing=Longest)
circle_libg = CircleNode(point_3, number_5, vector, lacing=Longest)
sweep_as_surface = SweepAsSurfaceNode(line_libg, circle_libg, lacing=Longest)
watch_3d = Watch3D(sweep_as_surface)
