# Dynamo graph SweepAsSolidTest.dyn (Dynamo 0.6.3.25915)

number = DoubleInput(0)
point = Point3DNode(number, number, number, lacing=Longest)
number_2 = DoubleInput(5)
number_3 = DoubleInput(-5)
point_2 = Point3DNode(number_2, number, number_3, lacing=Longest)
number_4 = DoubleInput(10)
point_3 = Point3DNode(number_4, number, number, lacing=Longest)
number_5 = DoubleInput(15)
point_4 = Point3DNode(number_5, number, number_2, lacing=Longest)
number_6 = DoubleInput(20)
point_5 = Point3DNode(number_6, number, number, lacing=Longest)
list = NewList(index0=point, index1=point_2, index2=point_3, index3=point_4, index4=point_5)
BSplineCurve = BSplineCurveNode(list, lacing=Longest)
watch_3d = Watch3D(BSplineCurve)
watch_3d_2 = Watch3D(list)
number_7 = DoubleInput(1)
vector = VectorNode(number, number, number_7, lacing=Longest)
circle_libg = CircleNode(point, number_7, vector, lacing=Longest)
sweep_as_solid = SweepAsSolidNode(BSplineCurve, circle_libg, lacing=Longest)
watch_3d_3 = Watch3D(sweep_as_solid)
length_libg = LengthNode(BSplineCurve, lacing=Longest)
