# Dynamo graph Sweep_NegativeScenario.dyn (Dynamo 0.6.3.23082)

number = DoubleInput(0)
point = Point3DNode(number, number, number, lacing=Longest)
number_2 = DoubleInput(2)
number_3 = DoubleInput(0)
number_4 = DoubleInput(1)
vector = VectorNode(number_3, number_3, number_4, lacing=Longest)
circle_libg = CircleNode(point, number_2, vector, lacing=Longest)
number_5 = DoubleInput(0)
point_2 = Point3DNode(number_5, number_5, number_5, lacing=Longest)
number_6 = DoubleInput(2)
number_7 = DoubleInput(1)
number_8 = DoubleInput(0)
vector_2 = VectorNode(number_7, number_8, number_8, lacing=Longest)
circle_libg_2 = CircleNode(point_2, number_6, vector_2, lacing=Longest)
sweep_as_surface = SweepAsSurfaceNode(circle_libg, circle_libg_2, lacing=Longest)
