# Dynamo graph ThickenSurfaceTest.dyn (Dynamo 0.7.0.25915)

number = DoubleInput(3)
number_2 = DoubleInput(1)
number_3 = DoubleInput(5)
point = Point3DNode(number, number_2, number_3, lacing=Longest)
number_4 = DoubleInput(1)
number_5 = DoubleInput(1..3)
number_6 = DoubleInput(5)
point_2 = Point3DNode(number_5, number_5, number_6, lacing=Longest)
remove_from_list = RemoveFromList(number_4, point_2)
add_to_list = List(point, remove_from_list)
BSplineCurve = BSplineCurveNode(add_to_list, lacing=Longest)
number_7 = DoubleInput(1)
number_8 = DoubleInput(0)
point_3 = Point3DNode(number_7, number_7, number_8, lacing=Longest)
number_9 = DoubleInput(3)
number_10 = DoubleInput(0)
point_4 = Point3DNode(number_9, number_9, number_10, lacing=Longest)
line_libg = LineNode(point_3, point_4, lacing=Longest)
list = NewList(index0=BSplineCurve, index1=line_libg)
patch = PatchNode(list, lacing=Longest)
number_11 = DoubleInput(0.25)
thicken_surface = ThickenSurfaceNode(patch, number_11, lacing=Longest)
