# Dynamo graph TranslateTest_SingleObject.dyn (Dynamo 0.6.3.25915)

number = DoubleInput(0)
point = Point3DNode(number, number, number, lacing=Longest)
number_2 = DoubleInput(5)
number_3 = DoubleInput(-5)
point_2 = Point3DNode(number_2, number, number_3, lacing=Longest)
number_4 = DoubleInput(10)
point_3 = Point3DNode(number_4, number, number, lacing=Longest)
number_5 = DoubleInput(15)
point_4 = Point3DNode(number_5, number, number_2, lacing=Longest)
number_6 = DoubleInput(20)
point_5 = Point3DNode(number_6, number, number, lacing=Longest)
list = NewList(index0=point, index1=point_2, index2=point_3, index3=point_4, index4=point_5)
BSplineCurve = BSplineCurveNode(list, lacing=Longest)
number_7 = DoubleInput(1)
vector = VectorNode(number, number, number_7, lacing=Longest)
circle_libg = CircleNode(point, number_7, vector, lacing=Longest)
sweep_as_solid = SweepAsSolidNode(BSplineCurve, circle_libg, lacing=Longest)
number_8 = DoubleInput(0)
number_9 = DoubleInput(2)
vector_2 = VectorNode(number_8, number_9, number_8, lacing=Longest)
translate = TranslateNode(sweep_as_solid, vector_2, lacing=Longest)
watch_3d = Watch3D(translate)
