# Dynamo graph TrimTest_UsingTwoSurface.dyn (Dynamo 0.7.0.18768)

number = DoubleInput(-3..6..#2)
number_2 = DoubleInput(-5)
number_3 = DoubleInput(0)
point = Point3DNode(number, number_2, number_3, lacing=Longest)
BSplineCurve = BSplineCurveNode(point, lacing=Longest)
number_4 = DoubleInput(-3..6..#2)
number_5 = DoubleInput(5)
number_6 = DoubleInput(0)
point_2 = Point3DNode(number_4, number_5, number_6, lacing=Longest)
BSplineCurve_2 = BSplineCurveNode(point_2, lacing=Longest)
list = NewList(index0=BSplineCurve, index1=BSplineCurve_2)
patch = PatchNode(list, lacing=Longest)
number_7 = DoubleInput(0)
number_8 = DoubleInput(-5)
point_3 = Point3DNode(number_7, number_7, number_8, lacing=Longest)
number_9 = DoubleInput(1)
number_10 = DoubleInput(0)
number_11 = DoubleInput(1)
vector = VectorNode(number_10, number_10, number_11, lacing=Longest)
circle_libg = CircleNode(point_3, number_9, vector, lacing=Longest)
number_12 = DoubleInput(10)
extrude_curve = ExtrudeNode(circle_libg, vector, number_12, lacing=Longest)
number_13 = DoubleInput(2)
number_14 = DoubleInput(0)
point_4 = Point3DNode(number_13, number_13, number_14, lacing=Longest)
trim = TrimNode(patch, extrude_curve, point_4, lacing=Longest)
number_15 = DoubleInput(10)
number_16 = DoubleInput(0)
vector_2 = VectorNode(number_15, number_16, number_16, lacing=Longest)
translate = TranslateNode(trim, vector_2, lacing=Longest)
watch_3d = Watch3D(translate)
