# Dynamo graph Trim_UsingPSurfaceAndCuboid.dyn (Dynamo 0.6.2.25053)

number = DoubleInput(0)
point = Point3DNode(number, number, number, lacing=Longest)
number_2 = DoubleInput(1)
number_3 = DoubleInput(0)
vector = VectorNode(number_2, number_3, number_3, lacing=Longest)
number_4 = DoubleInput(0)
number_5 = DoubleInput(1)
vector_2 = VectorNode(number_4, number_5, number_4, lacing=Longest)
coordinateSystem = CoordinateSystemNode(point, vector, vector_2, lacing=Longest)
number_6 = DoubleInput(4)
cuboid = CuboidNode(coordinateSystem, number_6, number_6, number_6, lacing=Longest)
number_7 = DoubleInput(-3)
number_8 = DoubleInput(0)
point_2 = Point3DNode(number_7, number_8, number_8, lacing=Longest)
number_9 = DoubleInput(3)
number_10 = DoubleInput(0)
point_3 = Point3DNode(number_9, number_10, number_10, lacing=Longest)
line_libg = LineNode(point_2, point_3, lacing=Longest)
number_11 = DoubleInput(4)
extrude_curve = ExtrudeNode(line_libg, vector_2, number_11, lacing=Longest)
number_12 = DoubleInput(1)
point_4 = Point3DNode(number_12, number_12, number_12, lacing=Longest)
trim = TrimNode(cuboid, extrude_curve, point_4, lacing=Longest)
number_13 = DoubleInput(0)
number_14 = DoubleInput(5)
vector_3 = VectorNode(number_13, number_13, number_14, lacing=Longest)
translate = TranslateNode(trim, vector_3, lacing=Longest)
