# Dynamo graph Trim_UsingPlaneAndCuboid.dyn (Dynamo 1.0.1.1743)

number = DoubleInput(0)
point = Point3DNode(number, lacing=Longest)
plane_libg = PlaneNode(point, lacing=Longest)
number_2 = DoubleInput(0)
vector = VectorNode(number_2, lacing=Longest)
number_3 = DoubleInput(1)
number_4 = DoubleInput(2)
number_5 = DoubleInput(1)
vector_2 = VectorNode(number_5, lacing=Longest)
number_6 = DoubleInput(0)
number_7 = DoubleInput(8)
number_8 = DoubleInput(2)
point_2 = Point3DNode(number_8, lacing=Longest)
number_9 = DoubleInput(0)
number_10 = DoubleInput(0)
point_3 = Point3DNode(number_10, lacing=Longest)
coordinateSystem = CoordinateSystemNode(point_3, lacing=Longest)
cuboid = CuboidNode(coordinateSystem, lacing=Longest)
trim = TrimNode(cuboid, lacing=Longest)
