# Dynamo graph VectorTest.dyn (Dynamo 0.7.0.25915)

number = DoubleInput(0)
point = Point3DNode(number, number, number, lacing=Longest)
number_2 = DoubleInput(1)
vector = VectorNode(number_2, number, number, lacing=Longest)
number_3 = DoubleInput(0)
number_4 = DoubleInput(1)
vector_2 = VectorNode(number_3, number_4, number_3, lacing=Longest)
coordinateSystem = CoordinateSystemNode(point, vector, vector_2, lacing=Longest)
# note: Vector property check
vector_x = VectorXNode(vector_2, lacing=Longest)
vector_y = VectorYNode(vector_2, lacing=Longest)
vector_z = VectorZNode(vector_2, lacing=Longest)
