# Dynamo graph Vector_PropertiesTest.dyn (Dynamo 1.0.1.1743)

number = DoubleInput(-1)
number_2 = DoubleInput(0)
formula = Formula("1*-3", lacing=Longest)
vector = VectorNode(formula, lacing=Longest)
vector_x = VectorXNode(vector, lacing=Longest)
vector_y = VectorYNode(vector, lacing=Longest)
vector_z = VectorZNode(vector, lacing=Longest)
