# Dynamo graph Vector_UsingCrossProduct.dyn (Dynamo 0.6.2.25053)

number = DoubleInput(0)
point = Point3DNode(number, number, number, lacing=Longest)
number_2 = DoubleInput(0.5)
number_3 = DoubleInput(1)
number_4 = DoubleInput(1..2)
number_5 = DoubleInput(0)
vector = VectorNode(number_4, number_4, number_5, lacing=CrossProduct)
get_from_list = GetFromList(number_3, vector)
circle_libg = CircleNode(point, number_2, get_from_list, lacing=Longest)
