# Dynamo graph ZeroLengthLine.dyn (Dynamo 0.6.3.20195)

number = DoubleInput(0)
point = Point3DNode(number, number, number, lacing=Longest)
point_2 = Point3DNode(number, number, number, lacing=Longest)
line_libg = LineNode(point, point_2, lacing=Longest)
