# Dynamo graph sat_import_with_units.dyn (Dynamo 2.16.0.2345)

code_block = CodeBlock { "..\\..\\..\\..\\Dynamo\\test\\core\\WorkflowTestFiles\\GeometryDefects\\SweepAsSolid\\profile.sat"; }
importFromSATWithUnits = Geometry.ImportFromSATWithUnits(file_filePath=code_block)
serializeAsSAB = Geometry.SerializeAsSAB(geometry=importFromSATWithUnits)
deserializeFromSABWithUnits = Geometry.DeserializeFromSABWithUnits(file_filePath=serializeAsSAB)
importFromSATWithUnits_2 = Geometry.ImportFromSATWithUnits(file_filePath=code_block)
serializeAsSAB_2 = Geometry.SerializeAsSAB(geometry=importFromSATWithUnits_2)
deserializeFromSABWithUnits_2 = Geometry.DeserializeFromSABWithUnits(file_filePath=serializeAsSAB_2)
units = Units("Decimeters")
deserializeFromSABWithUnits_3 = Geometry.DeserializeFromSABWithUnits(dynamoUnit=units)  # unwired: file_filePath
importFromSATWithUnits_3 = Geometry.ImportFromSATWithUnits()  # unwired: file_filePath
file_from_path = FileObject(path=code_block)
function_apply = ApplyFunction(function=importFromSATWithUnits_3, argument0=file_from_path)
serializeAsSAB_3 = Geometry.SerializeAsSAB(geometry=function_apply)
function_apply_2 = ApplyFunction(function=deserializeFromSABWithUnits_3, argument0=serializeAsSAB_3)
code_block_2 = CodeBlock { 10; }
ofRepeatedItem = List.OfRepeatedItem(item=code_block, amount=code_block_2)
importFromSATWithUnits_4 = Geometry.ImportFromSATWithUnits(file_filePath=ofRepeatedItem)
list_create = List.Create(item0=deserializeFromSABWithUnits, item1=deserializeFromSABWithUnits_2, item2=function_apply_2, item3=importFromSATWithUnits_4)
flatten = List.Flatten(list=list_create)
area = Surface.Area(surface=flatten)
sum = Math.Sum(values=area)
