# Dynamo graph tesselationwithcoincidentgridsRemember.dyn (Dynamo 4.2.0.4815)

# note: Wiggle Sliders
# for Awesome
get_surface_domain = CodeBlock { [[0,0],[1,1]]; }
number_slider = DoubleSlider(6.515, range=0..20 step 0.1)  # graph input
code_block = CodeBlock(domain=get_surface_domain, ucount=number_slider, vcount=number_slider) { domain[0][0]..domain[1][0]..#ucount+1; domain[0][1]..domain[1][1]..#vcount+1; }
byCoordinates = UV.ByCoordinates(u=code_block.out0, v=code_block.out1, lacing=CrossProduct)
flatten = List.Flatten(list=byCoordinates)
number_slider_2 = DoubleSlider(20, range=0..20 step 0.1)  # graph input
code_block_2 = CodeBlock(domain=get_surface_domain, ucount=number_slider_2, vcount=number_slider_2) { domain[0][0]..domain[1][0]..#ucount+1; domain[0][1]..domain[1][1]..#vcount+1; }
byCoordinates_2 = UV.ByCoordinates(u=code_block_2.out0, v=code_block_2.out1, lacing=CrossProduct)
flatten_2 = List.Flatten(list=byCoordinates_2)
join = List.Join(list0=flatten, list1=flatten_2)
remember = Remember()  # unwired: arg0
byParametersOnSurface = Tessellation.Voronoi.ByParametersOnSurface(uvs=join, face=remember)
final_list = List.Flatten(list=byParametersOnSurface)
