# Dynamo custom node GraphLayout.dyf "Diagonal Generation" (Dynamo 0.8.0.950)
# category: BIM4Struc.BridgeDesign
# Generate diagonals between two lists of  points

StartList = Input(StartList : var[]..[])
code_block = CodeBlock { n=2; offset=1; }
takeEveryNthItem = List.TakeEveryNthItem(StartList, code_block.n)
EndList = Input(EndList : var[]..[])
takeEveryNthItem_2 = List.TakeEveryNthItem(EndList, code_block.n, code_block.offset)
byStartPointEndPoint = Line.ByStartPointEndPoint(startPoint=takeEveryNthItem, endPoint=takeEveryNthItem_2)
restOfItems = List.RestOfItems(takeEveryNthItem_2)
byStartPointEndPoint_2 = Line.ByStartPointEndPoint(startPoint=takeEveryNthItem, endPoint=restOfItems)
join = List.Join(byStartPointEndPoint, byStartPointEndPoint_2)
Diagonals = Output(join)
