# Dynamo graph GraphLayoutComplex.dyn (Dynamo 0.8.0.1233)

code_block = CodeBlock { Point.ByCoordinates(0,0,0); Point.ByCoordinates(200,0,0); }
byStartPointEndPoint = Line.ByStartPointEndPoint(startPoint=code_block.out0, endPoint=code_block.out1)
number_of_panels_integer_slider = IntegerSlider(30, range=5..100 step 2)
code_block_2 = CodeBlock(n=number_of_panels_integer_slider) { 0..1..#n+1; }
# note: Division of bridge reference line
pointAtParameter = Curve.PointAtParameter(curve=byStartPointEndPoint, param=code_block_2, lacing=Longest)
ZAxis = Vector.ZAxis()
bridge_height_number = DoubleInput(10)
# note: Bridge Height Reference points. These are used for the Arc truss generation
translate = Geometry.Translate(geometry=pointAtParameter, direction=ZAxis, distance=bridge_height_number)
number_of_supports_integer = IntegerSlider(3, range=1..5 step 1)  # "Number of Supports / Integer Slider"
# note: When the number of supports or index shifts are too big for relatively small number of panels, the structure can get deformed.
# In that case, or increase the number of panels or decrease the number of supports and the index shift.
number_of_index_shifts_for_arc = IntegerSlider(3, range=1..5 step 1)  # "Number of Index Shifts for Arc Width / Integer Slider"
# note: Arc height is measured with respect to the bridge height reference.
height_arch_support_number = DoubleInput(10)
# note: Creation of the arc girder above support points.
top_arc_girder_code_block = CodeBlock(lst=translate, NrSupports=number_of_supports_integer, NumberOfShifts=number_of_index_shifts_for_arc, ArcHeight=height_arch_support_number)
# ---------- top_arc_girder_code_block.designscript (32 lines) ----------
//Input "lst" represents top reference points of bridge
//These points are depending on the bridge height of the rectangular part
//Calculation of support indexes
div=(List.Count(lst)/(NrSupports+1));
Support_Index=div-1..#NrSupports..div;
//Defining of indexes of arc/line joins
JoinLeft_Index=Support_Index-NumberOfShifts;
JoinRight_Index=Support_Index+NumberOfShifts;
//Defining the supporting point
pt_ref=lst[Support_Index];
pt_sup=pt_ref.Translate(Vector.ZAxis(),ArcHeight);
//Defining the points where arc joins the straight line
pt_L=lst[JoinLeft_Index];
pt_R=lst[JoinRight_Index];
//Defining the vector of the girder axis for arc direction
vec_L=Vector.ByTwoPoints(pt_L,pt_ref);
vec_R=Vector.ByTwoPoints(pt_R,pt_ref);
//Arcs
Arc1=Arc.ByStartPointEndPointStartTangent(pt_L,pt_sup,vec_L);
Arc2=Arc.ByStartPointEndPointStartTangent(pt_sup,pt_R,vec_R);
//Line between start of girder and first arc
L1={Line.ByStartPointEndPoint(lst[1],pt_L[0])};
//Lines between consecutive arcs
startpts=List.RemoveItemAtIndex(pt_R,List.Count(pt_R)-1);
endpts=List.RestOfItems(pt_L);
L2=Line.ByStartPointEndPoint(startpts,endpts);
//Line between last arc and end of girder
i=List.Count(lst)-2;
L3={Line.ByStartPointEndPoint(List.LastItem(pt_R),lst[i])};
//Polycurve
curves=List.Join({Arc1,Arc2,L1,L2,L3});
PolyCurve.ByJoinedCurves(curves);
# ----------------------------------------
ZAxis_2 = Vector.ZAxis()
# note: Projection of Bridge Height Reference Points on the polycurve. This will be used for diagonal creation in the top of the bridge girder plane.
project = Point.Project(pointAtParameter, top_arc_girder_code_block.out19, ZAxis_2, lacing=Longest)
flatten = Flatten(project)
firstItem = List.FirstItem(pointAtParameter)
lastItem = List.LastItem(pointAtParameter)
# note: Back : Bottom girder and end diagonals
byStartPointEndPoint_2 = Line.ByStartPointEndPoint(startPoint=firstItem, endPoint=lastItem)
firstItem_2 = List.FirstItem(flatten)
byStartPointEndPoint_3 = Line.ByStartPointEndPoint(startPoint=firstItem, endPoint=firstItem_2)
lastItem_2 = List.LastItem(flatten)
byStartPointEndPoint_4 = Line.ByStartPointEndPoint(startPoint=lastItem, endPoint=lastItem_2)
code_block_3 = CodeBlock(lst=pointAtParameter) { List.RemoveItemAtIndex(lst,{0,List.Count(lst)-1}); }
# note: Back: vertical bracings
diagonal_generation = Custom[Diagonal Generation](StartList=flatten, EndList=code_block_3)  # Generate diagonals between two lists of points
# note: Back: posts
byStartPointEndPoint_5 = Line.ByStartPointEndPoint(startPoint=code_block_3, endPoint=flatten)
code_block_4 = CodeBlock(lst=flatten) { List.RemoveItemAtIndex(lst,List.Count(lst)-1); }
# note: Take all items except for the last one
# note: Take all items except for the first one
restOfItems = List.RestOfItems(flatten)
# note: This method with Lines is used, since RSA can't handle polycurves, curves or arcs.
byStartPointEndPoint_6 = Line.ByStartPointEndPoint(startPoint=code_block_4, endPoint=restOfItems)
# note: List creation of all elements of the back part of the truss girder
# 0 = Top Girder Points
# 1 = Bottom Girder Points (first division node)
# 2 = Bottom Girder
# 3 = Left end diagonal
# 4 = Right end diagonal
# 5 = Vertical bracings
# 6 = Posts
# 7 = Top girder line (incl. Arc)
back_structure_list_create = List.Create(flatten, pointAtParameter, byStartPointEndPoint_2, byStartPointEndPoint_3, byStartPointEndPoint_4, diagonal_generation, byStartPointEndPoint_5, byStartPointEndPoint_6)
code_block_5 = CodeBlock { 0.5; }
# note: The normal vector on the middle of the bottom girder is defining the direction for the translation of the full back truss, to be sure the translation is perpendicular to the back truss. This is useful when the bridge is not aligned with the world X-axis.
normalAtParameter = Curve.NormalAtParameter(curve=byStartPointEndPoint_2, param=code_block_5)
bridge_width_number = DoubleInput(8)
# note: Generation of the front truss by translating the back truss with a value equal to the bridge width.
translate_2 = Geometry.Translate(geometry=back_structure_list_create, direction=normalAtParameter, distance=bridge_width_number)
code_block_6 = CodeBlock(lst=translate_2)
# ---------- code_block_6.designscript (4 lines) ----------
//Top girder line points front
lst[0];
//Bottom girder line points front
lst[1];
# ----------------------------------------
code_block_7 = CodeBlock(lst=back_structure_list_create)
# ---------- code_block_7.designscript (4 lines) ----------
//Top girder ine points back
lst[0];
//Bottom girder line points back
lst[1];
# ----------------------------------------
# note: Floor beams
byStartPointEndPoint_7 = Line.ByStartPointEndPoint(startPoint=code_block_6.out1, endPoint=code_block_7.out1)
max_span_stringers_number = DoubleInput(1.65)
code_block_8 = CodeBlock(BridgeWidth=bridge_width_number, MaxSpanStringers=max_span_stringers_number) { NrOfSpans=Math.Ceiling(BridgeWidth/MaxSpanStringers); param=1/NrOfSpans; ParamRange=param..0.9999..param; }
# note: Placeholder points for stringers
pointAtParameter_2 = Curve.PointAtParameter(curve=byStartPointEndPoint_7, param=code_block_8.ParamRange, lacing=CrossProduct)
transpose = List.Transpose(pointAtParameter_2)
reverse = List.Reverse()
map = List.Map(list=transpose, f_x=reverse)
restOfItems_2 = List.RestOfItems()
map_2 = List.Map(list=map, f_x=restOfItems_2)
reverse_2 = List.Reverse()
map_3 = List.Map(list=map_2, f_x=reverse_2)
restOfItems_3 = List.RestOfItems()
map_4 = List.Map(list=transpose, f_x=restOfItems_3)
byStartPointEndPoint_8 = Line.ByStartPointEndPoint(startPoint=map_3, endPoint=map_4)
transpose_2 = List.Transpose(byStartPointEndPoint_8)
identity = Object.Identity(transpose_2)
# note: Stringers
byLine = DynamoSimulation.RSA.AnalyticalModel.AnalyticalBar.ByLine(identity)
code_block_9 = CodeBlock()
# ---------- code_block_9.designscript (10 lines) ----------
"HEA 360";
"HEA 400";
"HEA 500";
"HEB 360";
"HEB 400";
"HEB 500";
"SHS 120x10";
"SHS 300x12";
"UKAEQ 100x10";
"IPE 400";
# ----------------------------------------
create = List.Create(code_block_9.out0, code_block_9.out1, code_block_9.out2, code_block_9.out3, code_block_9.out4, code_block_9.out5, code_block_9.out6, code_block_9.out7, code_block_9.out8, code_block_9.out9)
load_sections_to_rsa = Custom[Load Sections to RSA](Section_Name_List=create)  # Load a given list of Sections to the current RSA project.
code_block_10 = CodeBlock(Sections=load_sections_to_rsa) { Sections[9]; }
setSectionByName = DynamoSimulation.RSA.AnalyticalModel.AnalyticalBar.SetSectionByName(byLine, code_block_10)
identity_2 = Object.Identity(byStartPointEndPoint_7)
byLine_2 = DynamoSimulation.RSA.AnalyticalModel.AnalyticalBar.ByLine(identity_2)
code_block_11 = CodeBlock(Sections=load_sections_to_rsa) { Sections[1]; }
setSectionByName_2 = DynamoSimulation.RSA.AnalyticalModel.AnalyticalBar.SetSectionByName(byLine_2, code_block_11)
# note: Lateral bracings A in top part of the truss
diagonal_generation_2 = Custom[Diagonal Generation](StartList=code_block_6.out0, EndList=code_block_7.out0)
# note: Lateral bracings B in top part of the truss
diagonal_generation_3 = Custom[Diagonal Generation](StartList=code_block_7.out0, EndList=code_block_6.out0)
lateral_bracings_list_join = List.Join(diagonal_generation_2, diagonal_generation_3)
identity_3 = Object.Identity(lateral_bracings_list_join)
# note: Lateral wind bracings
byLine_3 = DynamoSimulation.RSA.AnalyticalModel.AnalyticalBar.ByLine(identity_3)
code_block_12 = CodeBlock(Sections=load_sections_to_rsa) { Sections[8]; }
setSectionByName_3 = DynamoSimulation.RSA.AnalyticalModel.AnalyticalBar.SetSectionByName(byLine_3, code_block_12)
code_block_13 = CodeBlock(lstBack=back_structure_list_create, lstFront=translate_2)
# ---------- code_block_13.designscript (4 lines) ----------
//Main girder elements (bottom & top)
Flatten({lstBack[{2,3,4,7}],lstFront[{2,3,4,7}]});
//Vertical Bracings & Posts
Flatten({lstBack[{5,6}],lstFront[{5,6}]});
# ----------------------------------------
identity_4 = Object.Identity(code_block_13.out1)
# note: Vertical bracings and posts
byLine_4 = DynamoSimulation.RSA.AnalyticalModel.AnalyticalBar.ByLine(identity_4)
code_block_14 = CodeBlock(Sections=load_sections_to_rsa) { Sections[7]; }
setSectionByName_4 = DynamoSimulation.RSA.AnalyticalModel.AnalyticalBar.SetSectionByName(byLine_4, code_block_14)
# note: THIS PROCEDURE CREATES INTERACTIVE A-FRAMES BETWEEN THE FRONT AND BACK TRUSS GIRDER
pointAtDistance = Curve.PointAtDistance(lacing=Longest)
# note: Placeholder for backposts
code_block_15 = CodeBlock(BackPost=byStartPointEndPoint_5) { BackPost; }
length = Curve.Length(code_block_15)
minimal_clearance_number = DoubleInput(7.7)
# note: !! IMPORTANT NOTICE:
# Right click on "distance" and switch off "default value". Otherwise it will take "1" by default since it hasn't a value assigned directly.
# note: Make a division of the posts, depending on the Minimal Clearance Height for the train. In case of large posts, the division will increase on that post with a value equal to the clearance.
# div = the number of divisions on a post, taking into account the clearance.
# dist = the resulting distance of the division on the line.
code_block_16 = CodeBlock(PostLength=length, Clearance=minimal_clearance_number) { div=Math.Ceiling((PostLength-Clearance)/Clearance); dist=Clearance*(1..div+1); }
# note: Use List.Combine to combine each element of the BackPost list with the several possible divisions per post. These divisions can vary per post. So BackPost[0] needs to be combined with dist[0]. BackPost[1] with dist[1], ...
combine = List.Combine(pointAtDistance, code_block_15, code_block_16.dist)
# note: Translate the nodes to the front truss. This method is analogue to the translation of the back truss (see above).
translate_3 = Geometry.Translate(geometry=combine, direction=normalAtParameter, distance=bridge_width_number)
# note: Connect the divider nodes to form the horizontal line of the A frames.
byStartPointEndPoint_9 = Line.ByStartPointEndPoint(startPoint=combine, endPoint=translate_3)
identity_5 = Object.Identity(byStartPointEndPoint_9)
# note: Portal struts
byLine_5 = DynamoSimulation.RSA.AnalyticalModel.AnalyticalBar.ByLine(identity_5)
code_block_17 = CodeBlock(Sections=load_sections_to_rsa) { Sections[0]; }
setSectionByName_5 = DynamoSimulation.RSA.AnalyticalModel.AnalyticalBar.SetSectionByName(byLine_5, code_block_17)
byStartPointEndPoint_10 = Line.ByStartPointEndPoint()
reverse_3 = List.Reverse()
map_5 = List.Map(list=translate_3, f_x=reverse_3)
restOfItems_4 = List.RestOfItems()
# note: Remove the last item of each sublist of the divisions on the FRONT posts, which is equal to the endpoint of each post. These points can not take part in the A-frame creation.
map_6 = List.Map(list=map_5, f_x=restOfItems_4)
reverse_4 = List.Reverse()
map_7 = List.Map(list=map_6, f_x=reverse_4)
code_block_18 = CodeBlock { 0.5; }
# note: Make a placeholder point for the apex of the A-frame. Remove the first item of the list, which is lying on the lowest horizontal part of the A-frame.
pointAtParameter_3 = Curve.PointAtParameter(curve=byStartPointEndPoint_9, param=code_block_18)
restOfItems_5 = List.RestOfItems()
map_8 = List.Map(list=pointAtParameter_3, f_x=restOfItems_5)
combine_2 = List.Combine(byStartPointEndPoint_10, map_7, map_8)
reverse_5 = List.Reverse()
map_9 = List.Map(list=combine, f_x=reverse_5)
restOfItems_6 = List.RestOfItems()
# note: Remove the last item of each sublist of the divisions on the BACK posts, which is equal to the endpoint of each post. These points can not take part in the A-frame creation.
map_10 = List.Map(list=map_9, f_x=restOfItems_6)
reverse_6 = List.Reverse()
map_11 = List.Map(list=map_10, f_x=reverse_6)
# note: Combine the three node lists with the line creation as combinator. This method is used to be sure that each element of the varying sublists are taken into account.
combine_3 = List.Combine(byStartPointEndPoint_10, map_11, map_8)
join = List.Join(combine_2, combine_3)
identity_6 = Object.Identity(join)
# note: Portal diagonals
byLine_6 = DynamoSimulation.RSA.AnalyticalModel.AnalyticalBar.ByLine(identity_6)
code_block_19 = CodeBlock(Sections=load_sections_to_rsa) { Sections[6]; }
setSectionByName_6 = DynamoSimulation.RSA.AnalyticalModel.AnalyticalBar.SetSectionByName(byLine_6, code_block_19)
identity_7 = Object.Identity(code_block_13.out0)
# note: Main girder elements
byLine_7 = DynamoSimulation.RSA.AnalyticalModel.AnalyticalBar.ByLine(identity_7)
code_block_20 = CodeBlock(Sections=load_sections_to_rsa) { Sections[2]; }
setSectionByName_7 = DynamoSimulation.RSA.AnalyticalModel.AnalyticalBar.SetSectionByName(byLine_7, code_block_20)
# note: Filter the bottom main girder beams for edge loading, top girders for stress analysis and the end diagonals for release defining
code_block_21 = CodeBlock(lst=setSectionByName_7)
# ---------- code_block_21.designscript (8 lines) ----------
//Selection of front and back bottom girders
cnt=List.Count(lst);
i=cnt/2;
BottomList=lst[{0,i}];
//Selection of front and back top girders
TopList=lst[{3..i-1,i+3..cnt-1}];
//Selection of end diagonals
EndDiagonals=lst[{1,2,i+1,i+2}];
# ----------------------------------------
bar_releases_list_join = List.Join(setSectionByName, setSectionByName_2, setSectionByName_3, setSectionByName_4, setSectionByName_5, setSectionByName_6, code_block_21.BottomList, code_block_21.EndDiagonals)
string = StringInput("Pinned-Pinned")
setReleaseByName = DynamoSimulation.RSA.AnalyticalModel.AnalyticalBar.SetReleaseByName(bar_releases_list_join, string)
case_nature = CaseNature("Dead")
case_type = CaseType("Simple")
code_block_22 = CodeBlock { "Selfweight"; }
byNatureAndType = DynamoSimulation.RSA.AnalyticalModel.Loads.LoadCase.ByNatureAndType(case_nature, case_type, code_block_22)
code_block_23 = CodeBlock { 1; }
# note: Selfweight of the structure
modelSelfWeight = DynamoSimulation.RSA.AnalyticalModel.Loads.LoadCase.ModelSelfWeight(byNatureAndType, code_block_23)
case_nature_2 = CaseNature("Dead")
case_type_2 = CaseType("Simple")
code_block_24 = CodeBlock { "Permanent"; }
byNatureAndType_2 = DynamoSimulation.RSA.AnalyticalModel.Loads.LoadCase.ByNatureAndType(case_nature_2, case_type_2, code_block_24)
code_block_25 = CodeBlock { -10000; }
# note: Weight of rail deck on stringers
# (N/m)
byBars = DynamoSimulation.RSA.AnalyticalModel.Loads.UniformLoad.ByBars(setSectionByName, byNatureAndType_2, arg4=code_block_25)
code_block_26 = CodeBlock { -8000; }
# note: Weight of deck, barrier and fence
# (N/m)
byBars_2 = DynamoSimulation.RSA.AnalyticalModel.Loads.UniformLoad.ByBars(code_block_21.BottomList, byNatureAndType_2, arg4=code_block_26)
# note: Select the range of stringers that need to be loaded with the train load
start_position_integer_slider = IntegerSlider(7, range=0..49 step 1)
number_of_stringers_integer = IntegerSlider(8, range=1..50 step 1)  # "Number of stringers / Integer Slider"
code_block_27 = CodeBlock(i=start_position_integer_slider, j=number_of_stringers_integer) { {i..i+j}; }
getItemAtIndex = List.GetItemAtIndex(list=setSectionByName, index=code_block_27)
case_nature_3 = CaseNature("Live")
case_type_3 = CaseType("Simple")
code_block_28 = CodeBlock { "Train Load"; }
byNatureAndType_3 = DynamoSimulation.RSA.AnalyticalModel.Loads.LoadCase.ByNatureAndType(case_nature_3, case_type_3, code_block_28)
code_block_29 = CodeBlock { -80000; }
# note: Train loading on part of the structure
# (N/m)
byBars_3 = DynamoSimulation.RSA.AnalyticalModel.Loads.UniformLoad.ByBars(getItemAtIndex, byNatureAndType_3, arg4=code_block_29)
load_list_list_create = List.Create(modelSelfWeight, byBars, byBars_2, byBars_3)
bar_list_object_identity = Object.Identity(setSectionByName_7)
startNode = DynamoSimulation.RSA.AnalyticalModel.AnalyticalBar.StartNode(code_block_21.BottomList)
code_block_30 = CodeBlock { "Abutment Sliding"; }
code_block_31 = CodeBlock { {0,0,1,1,1,1}; }
define_support_in_rsa = Custom[Define support in RSA](Support_Name=code_block_30, Support_Definition_List=code_block_31)  # Make a new rigid support definition in RSA. The definition should be made for the UX,UY,UZ,RX,RY,RZ directions. With "0" you indicate a free direction, with "1" you indicate a fixed direction. The definitions should be set in a list (i.e. {1,1,1,0,0,0} will generate a "xxxfff" connection.
setSupportByName = DynamoSimulation.RSA.AnalyticalModel.AnalyticalNode.SetSupportByName(startNode, define_support_in_rsa)
getItemAtIndex_2 = List.GetItemAtIndex(list=setSectionByName_2, index=top_arc_girder_code_block.Support_Index)
startNode_2 = DynamoSimulation.RSA.AnalyticalModel.AnalyticalBar.StartNode(getItemAtIndex_2)
endNode = DynamoSimulation.RSA.AnalyticalModel.AnalyticalBar.EndNode(getItemAtIndex_2)
support_nodes_list_join = List.Join(startNode_2, endNode)
# note: Get the items of the Floor Beams above the support points, calculated in the "Top Arc Girder" Code Block
code_block_32 = CodeBlock { "Pier Sliding"; }
# note: Define the necessary supports for the structure.
code_block_33 = CodeBlock { {0,0,1,0,0,1}; }
define_support_in_rsa_2 = Custom[Define support in RSA](Support_Name=code_block_32, Support_Definition_List=code_block_33)
setSupportByName_2 = DynamoSimulation.RSA.AnalyticalModel.AnalyticalNode.SetSupportByName(support_nodes_list_join, define_support_in_rsa_2)
join_2 = List.Join(load_list_list_create, bar_list_object_identity, setSupportByName, setSupportByName_2)
flatten_2 = Flatten(join_2)
calculateAndSort = DynamoSimulation.RSA.RSACore.CalculateAndSort(flatten_2)
code_block_34 = CodeBlock { 1; }
getValues = DynamoSimulation.RSA.RSAResults.NodeReactions.GetValues(calculateAndSort.out1, code_block_34)
formula = Formula("FZ/1000;", FZ=getValues.out2)
watch = Watch(formula)
support_nodes_list_join_2 = List.Join(startNode)
# note: RX, RY, RZ is fixed because of the released connecting bars
endNode_2 = DynamoSimulation.RSA.AnalyticalModel.AnalyticalBar.EndNode(code_block_21.BottomList)
string_2 = StringInput("Fixed")
setSupportByName_3 = DynamoSimulation.RSA.AnalyticalModel.AnalyticalNode.SetSupportByName(endNode_2, string_2)
