# Dynamo graph GraphLayoutConnectedGroups.dyn (Dynamo 0.8.3.2432)

code_block = CodeBlock { 0..9; }
code_block_2 = CodeBlock { 10; 4; }
# note: This is another note.
byCoordinates = Point.ByCoordinates(x=code_block, y=code_block_2.out0, z=code_block_2.out1)
code_block_3 = CodeBlock { 0..5; }
code_block_4 = CodeBlock { 0..9; }
code_block_5 = CodeBlock { 0..9; }
code_block_6 = CodeBlock { -10; 4; }
byCoordinates_2 = Point.ByCoordinates(x=code_block_5, y=code_block_6.out0, z=code_block_6.out1)
# note: This is a note
code_block_7 = CodeBlock { 0..5; }
byCoordinates_3 = Point.ByCoordinates(x=code_block_7, y=code_block_6.out0)
byStartPointEndPoint = Line.ByStartPointEndPoint(startPoint=byCoordinates_2, endPoint=byCoordinates_3)
code_block_8 = CodeBlock { 4; }
byCoordinates_4 = Point.ByCoordinates(x=code_block_4, y=byStartPointEndPoint, z=code_block_8)
code_block_9 = CodeBlock { 0..5; }
byCoordinates_5 = Point.ByCoordinates(x=code_block_9, y=byStartPointEndPoint)
byStartPointEndPoint_2 = Line.ByStartPointEndPoint(startPoint=byCoordinates_4, endPoint=byCoordinates_5, lacing=Longest)
byCoordinates_6 = Point.ByCoordinates(x=code_block_3, y=code_block_2.out0, z=byStartPointEndPoint_2)
byStartPointEndPoint_3 = Line.ByStartPointEndPoint(startPoint=byCoordinates, endPoint=byCoordinates_6, lacing=CrossProduct)
watch = Watch(byStartPointEndPoint_3)
