# Dynamo graph GraphLayoutCrossings.dyn (Dynamo 0.8.3.2452)

code_block = CodeBlock { d; e; f; }
code_block_2 = CodeBlock { a; b; c; }
code_block_3 = CodeBlock(g=code_block.d, h=code_block.f, i=code_block_2.b) { g; h; i; }
code_block_4 = CodeBlock(j=code_block_2.c, k=code_block.e, l=code_block_2.a) { j; k; l; }
