# Dynamo graph GraphLayoutCyclic.dyn (Dynamo 0.8.3.2432)

length = String.Length(watch_2)
watch = Watch(length)
code_block = CodeBlock { "put"; }
code_block_2 = CodeBlock { "come"; }
replace = String.Replace(str=watch, searchFor=code_block, replaceWith=code_block_2)
watch_2 = Watch(replace)
code_block_3 = CodeBlock { " to"; }
watch_3 = Watch(countOccurrences)
indexOf = String.IndexOf(string=watch_2, searchFor=code_block_3, ignoreCase=watch_3)
watch_4 = Watch(indexOf)
sub = watch - watch_4
remove = String.Remove(str=watch_2, startIndex=watch_4, count=sub)
watch_5 = Watch(remove)
code_block_4 = CodeBlock { "ar"; }
countOccurrences = String.CountOccurrences(watch_5, code_block_4)
code_block_5 = CodeBlock(cycle2=code_block_6) { cycle2; }
code_block_6 = CodeBlock(cycle1=code_block_5) { cycle1; }
