# Dynamo graph GraphLayoutCyclicGroups.dyn (Dynamo 0.8.3.2432)

code_block = CodeBlock { 0..9; }
code_block_2 = CodeBlock { 0..5; }
code_block_3 = CodeBlock { 0..9; }
code_block_4 = CodeBlock { -10; 4; }
byCoordinates = Point.ByCoordinates(x=code_block_3, y=code_block_4.out0, z=code_block_4.out1)
code_block_5 = CodeBlock { 0..5; }
code_block_6 = CodeBlock { 0..9; }
code_block_7 = CodeBlock { 10; 4; }
byCoordinates_2 = Point.ByCoordinates(x=code_block_6, y=code_block_7.out0, z=code_block_7.out1)
code_block_8 = CodeBlock { 0..5; }
code_block_9 = CodeBlock { 4; }
byCoordinates_3 = Point.ByCoordinates(x=code_block, y=byStartPointEndPoint_3, z=code_block_9)
byStartPointEndPoint = Line.ByStartPointEndPoint(startPoint=byCoordinates_3, endPoint=byCoordinates_6, lacing=Longest)
byCoordinates_4 = Point.ByCoordinates(x=code_block_8, y=code_block_7.out0, z=byStartPointEndPoint)
byStartPointEndPoint_2 = Line.ByStartPointEndPoint(startPoint=byCoordinates_2, endPoint=byCoordinates_4, lacing=CrossProduct)
watch = Watch(byStartPointEndPoint_2)
byCoordinates_5 = Point.ByCoordinates(x=code_block_5, y=code_block_4.out0, z=watch)
byStartPointEndPoint_3 = Line.ByStartPointEndPoint(startPoint=byCoordinates, endPoint=byCoordinates_5)
byCoordinates_6 = Point.ByCoordinates(x=code_block_2, y=byStartPointEndPoint_3)
