# Dynamo graph GraphLayoutGroupedNotes.dyn (Dynamo 0.9.1.3501)

number = DoubleInput(0)
number_2 = DoubleInput(10)
number_3 = DoubleInput(1)
# note: Basic Geometric Elements have default values for numerical inputs.
# note: Arrays of Geometry can be created using Sequences, Ranges, and Lists
range = Range(start=number, end=number_2, step=number_3, lacing=Longest)
# note: Make 1, 2, and 3 dimensional arrays by passing Ranges into the points x, y, and z ports, then changing the Lacing properties in the right click menue for the node
byCoordinates = Point.ByCoordinates(y=range)
