# Dynamo graph GraphLayoutTree.dyn (Dynamo 0.8.3.2432)

code_block = CodeBlock { "put"; }
code_block_2 = CodeBlock { "come"; }
replace = String.Replace(searchFor=code_block, replaceWith=code_block_2)
# note: This is a note.
watch = Watch(replace)
code_block_3 = CodeBlock { " to"; }
indexOf = String.IndexOf(string=watch, searchFor=code_block_3)
watch_2 = Watch(indexOf)
length = String.Length(watch)
watch_3 = Watch(length)
sub = watch_3 - watch_2
# note: This is another note.
remove = String.Remove(str=watch, startIndex=watch_2, count=sub)
watch_4 = Watch(remove)
code_block_4 = CodeBlock { "ar"; }
countOccurrences = String.CountOccurrences(watch_4, code_block_4)
watch_5 = Watch(countOccurrences)
