# Dynamo graph GraphLayoutUnconnectedGroups.dyn (Dynamo 0.8.3.2432)

code_block = CodeBlock { 0..9; }
code_block_2 = CodeBlock { 4; }
byCoordinates = Point.ByCoordinates(x=code_block, z=code_block_2)
code_block_3 = CodeBlock { 0..5; }
byCoordinates_2 = Point.ByCoordinates(x=code_block_3)
byStartPointEndPoint = Line.ByStartPointEndPoint(startPoint=byCoordinates, endPoint=byCoordinates_2, lacing=Longest)
code_block_4 = CodeBlock { 0..9; }
code_block_5 = CodeBlock { -10; 4; }
byCoordinates_3 = Point.ByCoordinates(x=code_block_4, y=code_block_5.out0, z=code_block_5.out1)
code_block_6 = CodeBlock { 0..5; }
byCoordinates_4 = Point.ByCoordinates(x=code_block_6, y=code_block_5.out0)
byStartPointEndPoint_2 = Line.ByStartPointEndPoint(startPoint=byCoordinates_3, endPoint=byCoordinates_4)
code_block_7 = CodeBlock { 0..9; }
code_block_8 = CodeBlock { 10; 4; }
byCoordinates_5 = Point.ByCoordinates(x=code_block_7, y=code_block_8.out0, z=code_block_8.out1)
code_block_9 = CodeBlock { 0..5; }
byCoordinates_6 = Point.ByCoordinates(x=code_block_9, y=code_block_8.out0)
byStartPointEndPoint_3 = Line.ByStartPointEndPoint(startPoint=byCoordinates_5, endPoint=byCoordinates_6, lacing=CrossProduct)
watch = Watch(byStartPointEndPoint_3)
