# Dynamo graph HeterogeneousInputsValid.dyn (Dynamo 2.1.0.4395)

code_block = CodeBlock { 1..3; }
code_block_2 = CodeBlock { 0; 0.5; }
replaceItemAtIndex = List.ReplaceItemAtIndex(list=code_block, index=code_block_2.out0, item=code_block_2.out1)
add = code_block + replaceItemAtIndex  # lacing=CrossProduct
