# Dynamo graph LacingTest.dyn (Dynamo 0.7.4.3136)

number = DoubleInput(5)
number_2 = DoubleInput(5)
add = number + number_2
number_3 = DoubleInput(7)
byCoordinates = Point.ByCoordinates(add, number_3)
