# Dynamo graph testadd.dyn (Dynamo 1.1.1.2030)

code_block = CodeBlock { {{1,2}, {3, 4}}; }
code_block_2 = CodeBlock { {{"foo", "bar"}, {"baz", "qux"}}; }
add = code_block@L1 + code_block_2@L1
watch = Watch(add)
