# Dynamo graph testdomlacing1.dyn (Dynamo 1.1.1.2030)

code_block = CodeBlock { {{{1,2}, {3, 4}}, {{5, 6}}}; }
code_block_2 = CodeBlock { "a".."d"; }
sumAndConcat = FFITarget.AtLevelTestClass.SumAndConcat(code_block@L2, code_block_2@@L1, lacing=Longest)
watch = Watch(sumAndConcat)
