# Dynamo graph testdomlacing2.dyn (Dynamo 1.1.1.2030)

code_block = CodeBlock { {{{1,2}, {3, 4}}, {{5, 6}, {7, 8}}}; }
code_block_2 = CodeBlock { "a".."c"; }
sumAndConcat = FFITarget.AtLevelTestClass.SumAndConcat(code_block@@L2, code_block_2@L1, lacing=Longest)
watch = Watch(sumAndConcat)
