# Dynamo graph testfunctioncall.dyn (Dynamo 2.13.0.2066)

code_block = CodeBlock { l1 = [[1,2],[3,4]]; l2 = [[5,6],[7,8]]; num = 1; }
code_block_2 = CodeBlock(l2=code_block.l2, l1=code_block.l1, num=code_block.num)
# ---------- code_block_2.designscript (2 lines) ----------
t3 = DSCore.List.RemoveItemAtIndex(l2,
DSCore.List.Cycle(l1, num)@L1<1>);
# ----------------------------------------
watch = Watch(code_block_2)
