# Dynamo graph testnotdom.dyn (Dynamo 1.1.1.2030)

code_block = CodeBlock { {{{1,2}, {3, 4}}}; }
atLevelTestClass = FFITarget.AtLevelTestClass.AtLevelTestClass(code_block@L1)
V = FFITarget.AtLevelTestClass.V(atLevelTestClass)
watch = Watch(V)
