# Dynamo graph Reverse_NumberRange.dyn

number = DoubleInput(-1)
number_slider = DoubleSliderInput(6.875642343, range=0..10)
number_2 = DoubleInput(1)
number_range = NumberRange(number, number_slider, number_2, lacing=Longest)
reverse = Reverse(number_range)
watch = Watch(reverse)
watch_2 = Watch(number_range)
