# Dynamo graph Sort_SimpleNumbers.dyn

number = DoubleInput(2)
number_2 = DoubleInput(0)
number_3 = DoubleInput(9)
number_4 = DoubleInput(10)
number_5 = DoubleInput(3.5)
number_6 = DoubleInput(7)
number_7 = DoubleInput(4.6)
number_8 = DoubleInput(1.7)
list = NewList(index0=number, index1=number_2, index2=number_3, index3=number_4, index4=number_5, index5=number_6, index6=number_7, index7=number_8)
sort = Sort(list)
watch = Watch(sort)
watch_2 = Watch(list)
