# Dynamo graph Sort_Strings.dyn

string = StringInput("dddd")
string_2 = StringInput("aa")
string_3 = StringInput("a")
string_4 = StringInput("rrrrrrrrr")
string_5 = StringInput("bbbbbbbbbbbbb")
list = NewList(index0=string, index1=string_2, index2=string_3, index3=string_4, index4=string_5)
sort = Sort(list)
watch = Watch(sort)
watch_2 = Watch(list)
