# Dynamo graph MixedPackageLoadTest.dyn (Dynamo 2.7.0.8205)
# packages: Mixed Package 1.0.0

integer_slider = IntegerSlider(10, range=0..20 step 1)
code_block = CodeBlock { 10; 1..10; }
circles = Custom[circles](x=integer_slider, radius=code_block.out0)  # package Mixed Package
solution1 = FrogRiverOne.FrogRiverOne.Solution1(X=code_block.out0, A=code_block.out1)
