# Dynamo graph NodeStates.dyn (Dynamo 1.3.1.1736)

# group: dead
color_range = ColorRange()  # unwired: arg0, arg1, arg2

# group: warning
code_block = CodeBlock { 1; }
color_range_2 = ColorRange(arg1=code_block)  # unwired: arg0, arg2

# group: active
unit_types = UnitTypes("Area")
