# Dynamo graph Operators.dyn (Dynamo 2.16.0.1640)

add_operator = CodeBlock { a=1+2; b=1.5+2; c=1+2.5; d=1.3+2.5; e="abc"+"def"; }
sub_operator = CodeBlock { a=1-2; b=1.5-2; c=1-2.5; d=1.3-2.5; }
mul_operator = CodeBlock { a=1*2; b=1.5*2; c=1*2.5; d=1.3*2.5; }
div_operator = CodeBlock { a=1/2; b=1.5/2; c=1/2.5; d=1.3/2.5; }
mod_operator = CodeBlock { a=1%2; b=-1.5%2; c=1%-2.5; d=1.3%2.5; }
toboolean_conversions = CodeBlock { a=true==true; b=true==2; c=true==null; d=true==2.5; e="true"==true; f=""==true; g='t'==true; }
eq_operator = CodeBlock { a=true==false; b=3==3; c=3.5==3.5; d=3.5==3; e="abc"=="def"; }
nq_operator = CodeBlock { a=true!=false; b=3!=3; c=3.5!=3.5; d=3.5!=3; e="abc"!="def"; }
gt_operator = CodeBlock { a=1>2; b=1.0>2; c=1.0>2.0; }
lt_operator = CodeBlock { a=1<2; b=1.0<2; c=1.0<2.0; }
ge_operator = CodeBlock { a=1>=2; b=1.0>=2; c=1.0>=1.0; }
le_operator = CodeBlock { a=1<=2; b=1.0<=2; c=1.0<=1.0; }
