# Dynamo graph color-geometry-minimal.dyn "lotsofcoloredstuff-minimal" (Dynamo 2.17.0.2705)

code_block = CodeBlock { 1..2; }
byCoordinates = Point.ByCoordinates(x=code_block, y=code_block, z=code_block, lacing=CrossProduct)
byARGB = Color.ByARGB()
byGeometryColor = Modifiers.GeometryColor.ByGeometryColor(geometry=byCoordinates, color=byARGB)
