# Dynamo graph cross_product_lacing_2.dyn (Dynamo 2.17.0.2655)

code_block = CodeBlock { 1..20; 3..100; }
byCoordinates = Point.ByCoordinates(x=code_block.out0, y=code_block.out1, lacing=CrossProduct)
count = List.Count(list=byCoordinates)
code_block_2 = CodeBlock { 5; }
chop = List.Chop(list=byCoordinates, lengths=code_block_2)
firstItem = List.FirstItem(list=chop, lacing=CrossProduct)
code_block_3 = CodeBlock { 1..20; 3..100; 4..15; }
byCoordinates_2 = Point.ByCoordinates(x=code_block_3.out0, y=code_block_3.out1, z=code_block_3.out2, lacing=CrossProduct)
code_block_4 = CodeBlock { 5; }
chop_2 = List.Chop(list=byCoordinates_2, lengths=code_block_4)
firstItem_2 = List.FirstItem(list=chop_2, lacing=CrossProduct)
count_2 = List.Count(list=byCoordinates_2)
