# Dynamo graph cross_product_lacing_arrays.dyn (Dynamo 2.17.0.2655)

code_block = CodeBlock { 5..9; 0..130000; 0..550; }
code_block_2 = CodeBlock { 5; }
chop = List.Chop(list=code_block.out1, lengths=code_block_2)
code_block_3 = CodeBlock(t1=chop, t2=code_block.out0) { num1 =  DSCore.List.IndexOf(t1<2>, t2<1>); }
code_block_4 = CodeBlock(t1=chop, t2=code_block.out0) { num1 =  DSCore.List.IndexOf(t1<2L>, t2<1L>); }
chop_2 = List.Chop(list=code_block.out2, lengths=code_block_2)
max = Math.Max(value1=chop_2, value2=chop_2, lacing=CrossProduct)
max_2 = Math.Max(value1=code_block.out2, value2=code_block.out2, lacing=CrossProduct)
sum = Math.Sum(values=chop_2, lacing=CrossProduct)
add = chop_2 + chop_2  # lacing=CrossProduct
add_2 = code_block.out2 + code_block.out2  # lacing=CrossProduct
sum_2 = Math.Sum(values=code_block.out2, lacing=CrossProduct)
