# Dynamo graph double_range_sum.dyn "RangeTest" (Dynamo 2.16.0.1985)

code_block = CodeBlock { 0; 10; 0.2; }
code_block_2 = CodeBlock(start=code_block.out0, end=code_block.out1, step=code_block.out2) { start..end..step; }
sum = Math.Sum(values=code_block_2)
