# Dynamo graph ienumerable_int_double_coercion.dyn (Dynamo 2.16.0.2097)

code_block = CodeBlock { [1,2,3.7,4]; }
returnIEnumerableOfInt = FFITarget.DummyCollection.ReturnIEnumerableOfInt(data=code_block)
sum = Math.Sum(values=returnIEnumerableOfInt)
