# Dynamo graph ilist_t_ienumerable_coerce.dyn (Dynamo 2.16.0.2097)

arrayMember = FFITarget.ArrayMember.ArrayMember()
foo = FFITarget.ArrayMember.foo(arrayMember=arrayMember)
sum = Math.Sum(values=foo)
