# Dynamo graph index_mixed_type_nested_array.dyn (Dynamo 2.16.0.2167)

code_block = CodeBlock { [[1,2,3],[1.1,2.2,3.3],[Point.ByCoordinates(0,0,0)],[1.0,1,2.2,4.4,5]]; }
code_block_2 = CodeBlock(a=code_block) { a[0]; }
code_block_3 = CodeBlock(a=code_block) { a[1]; }
code_block_4 = CodeBlock(a=code_block) { a[2]; }
code_block_5 = CodeBlock(a=code_block) { a[1][1]; }
code_block_6 = CodeBlock(a=code_block) { a[3]; }
list_create = List.Create(item0=code_block_2, item1=code_block_3, item2=code_block_4, item3=code_block_5, item4=code_block_6)
