# Dynamo graph instance_method.dyn (Dynamo 2.16.0.2097)

byCoordinates = Point.ByCoordinates()
code_block = CodeBlock { 12; 423; 42; }
translate = Geometry.Translate(geometry=byCoordinates, xTranslation=code_block.out0, yTranslation=code_block.out1, zTranslation=code_block.out2)
