# Dynamo graph list_array_coercion.dyn (Dynamo 2.16.0.2097)

code_block = CodeBlock { ["a", "b", "c", "d"]; }
code_block_2 = CodeBlock { 1; 2; 0; }
XYZ = FFITarget.DummyTuple4.XYZ(xValue=code_block_2.out0, yValue=code_block_2.out1, zValue=code_block_2.out2)
coordinates3 = FFITarget.DummyTuple4.Coordinates3(dummyTuple4=XYZ)
removeItemsAtIndices = FFITarget.TestData.RemoveItemsAtIndices(list=code_block, indices=coordinates3)
