# Dynamo graph list_ienumerable_coercion.dyn (Dynamo 2.16.0.2097)

code_block = CodeBlock { 10; 12; 15; }
XYZ = FFITarget.DummyTuple4.XYZ(xValue=code_block.out0, yValue=code_block.out1, zValue=code_block.out2)
coordinates3 = FFITarget.DummyTuple4.Coordinates3(dummyTuple4=XYZ)
returnIEnumerableOfInt = FFITarget.DummyCollection.ReturnIEnumerableOfInt(data=coordinates3)
