# Dynamo graph longest_shortest_lacing.dyn (Dynamo 2.17.0.2655)

code_block = CodeBlock { 1..20; 3..100; }
byCoordinates = Point.ByCoordinates(x=code_block.out0, y=code_block.out1, lacing=CrossProduct)
count = List.Count(list=byCoordinates)
byCoordinates_2 = Point.ByCoordinates(x=code_block.out0, y=code_block.out1, lacing=Longest)
count_2 = List.Count(list=byCoordinates_2)
byCoordinates_3 = Point.ByCoordinates(x=code_block.out0, y=code_block.out1, lacing=Shortest)
count_3 = List.Count(list=byCoordinates_3)
code_block_2 = CodeBlock { 5; }
chop = List.Chop(list=byCoordinates_3, lengths=code_block_2)
firstItem = List.FirstItem(list=chop)
chop_2 = List.Chop(list=byCoordinates, lengths=code_block_2)
firstItem_2 = List.FirstItem(list=chop_2, lacing=CrossProduct)
chop_3 = List.Chop(list=byCoordinates_2, lengths=code_block_2)
firstItem_3 = List.FirstItem(list=chop_3, lacing=Longest)
firstItem_4 = List.FirstItem(list=chop, lacing=Shortest)
code_block_3 = CodeBlock(t1=chop_3, t3=chop, t5=chop_2) { t2 = DSCore.List.FirstItem(t1<1L>); t4 = DSCore.List.FirstItem(t3<1>); t6 = DSCore.List.FirstItem(t5<1>); }
