# Dynamo graph longest_shortest_lacing_arrays.dyn (Dynamo 2.17.0.2655)

code_block = CodeBlock { 5..9; 0..130000; }
code_block_2 = CodeBlock { 5; }
chop = List.Chop(list=code_block.out1, lengths=code_block_2)
code_block_3 = CodeBlock(t1=chop, t2=code_block.out0) { num1 =  DSCore.List.IndexOf(t1<1>, t2<1>); }
code_block_4 = CodeBlock(t1=chop, t2=code_block.out0) { num1 =  DSCore.List.IndexOf(t1<2>, t2<1>); }
code_block_5 = CodeBlock(t1=chop, t2=code_block.out0) { num1 = DSCore.List.IndexOf(t1<1L>, t2<1L>); }
code_block_6 = CodeBlock(t1=chop, t2=code_block.out0) { num1 =  DSCore.List.IndexOf(t1<1>, t2); }
code_block_7 = CodeBlock(t1=chop, t2=code_block.out0) { num1 =  DSCore.List.IndexOf(t1, t2<1>); }
code_block_8 = CodeBlock(t1=chop, t2=code_block.out0) { num1 =  DSCore.List.IndexOf(t1<1L>, t2); }
code_block_9 = CodeBlock(t1=chop, t2=code_block.out0) { num1 =  DSCore.List.IndexOf(t1, t2<1L>); }
code_block_10 = CodeBlock(t1=chop, t2=code_block.out0) { num1 =  DSCore.List.IndexOf(t1<2L>, t2<1L>); }
