# Dynamo graph lotsofcoloredstuff-simplified.dyn (Dynamo 2.17.0.2705)

code_block = CodeBlock { 0..50..2; }
byCoordinates = Point.ByCoordinates(x=code_block, y=code_block, z=code_block, lacing=CrossProduct)
code_block_2 = CodeBlock { 0.7; 75; 255; 255; }
byCenterPointRadius = Circle.ByCenterPointRadius(centerPoint=byCoordinates, radius=code_block_2.out0)
byARGB = Color.ByARGB(red=code_block_2.out1)
byGeometryColor = Modifiers.GeometryColor.ByGeometryColor(geometry=byCenterPointRadius, color=byARGB)
byCenterPointRadius_2 = Sphere.ByCenterPointRadius(centerPoint=byCoordinates, radius=code_block_2.out0)
byARGB_2 = Color.ByARGB(green=code_block_2.out2, blue=code_block_2.out1)
byGeometryColor_2 = Modifiers.GeometryColor.ByGeometryColor(geometry=byCenterPointRadius_2, color=byARGB_2)
byLengths = Cuboid.ByLengths(origin=byCoordinates)
byARGB_3 = Color.ByARGB(red=code_block_2.out2, blue=code_block_2.out3)
byGeometryColor_3 = Modifiers.GeometryColor.ByGeometryColor(geometry=byLengths, color=byARGB_3)
edges = Topology.Edges(topology=byLengths)
curveGeometry = Edge.CurveGeometry(edge=edges)
byARGB_4 = Color.ByARGB(red=code_block_2.out3, green=code_block_2.out2)
byGeometryColor_4 = Modifiers.GeometryColor.ByGeometryColor(geometry=curveGeometry, color=byARGB_4)
