# Dynamo graph point_sphere.dyn (Dynamo 2.16.0.1640)

code_block = CodeBlock { 56; 89; 74; }
byCoordinates = Point.ByCoordinates(x=code_block.out0, y=code_block.out1, z=code_block.out2)
byCenterPointRadius = Sphere.ByCenterPointRadius(centerPoint=byCoordinates)
