# Dynamo graph replication_wrappers_reused.dyn (Dynamo 2.16.0.1926)

code_block = CodeBlock { 0..10; }
byCoordinates = Point.ByCoordinates(x=code_block, y=code_block, z=code_block, lacing=CrossProduct)
X = Point.X(point=byCoordinates)
X_2 = Point.X(point=byCoordinates)
X_3 = Point.X(point=byCoordinates)
X_4 = Point.X(point=byCoordinates)
X_5 = Point.X(point=byCoordinates)
X_6 = Point.X(point=byCoordinates)
X_7 = Point.X(point=byCoordinates)
X_8 = Point.X(point=byCoordinates)
X_9 = Point.X(point=byCoordinates)
X_10 = Point.X(point=byCoordinates)
X_11 = Point.X(point=byCoordinates)
X_12 = Point.X(point=byCoordinates)
X_13 = Point.X(point=byCoordinates)
X_14 = Point.X(point=byCoordinates)
X_15 = Point.X(point=byCoordinates)
X_16 = Point.X(point=byCoordinates)
