# Dynamo graph PolycurveByPoints.dyn (Dynamo 3.4.0.6695)

code_block = CodeBlock { [19000,19001,20000,20001,30000,30001,40000,40002]; }
byCoordinates = Point.ByCoordinates(x=code_block)
byPoints = PolyCurve.ByPoints(points=byCoordinates)
