# Dynamo graph MalformedStates.dyn (Dynamo 0.8.1.976)

number = DoubleInput(0)
code_block = CodeBlock { 3; 100; 50; }
add = number + code_block.out0
add_2 = add + code_block.out1
watch = Watch(add_2)
