# Dynamo graph RunSettingsDisableRun.dyn (Dynamo 2.3.0.4640)

code_block = CodeBlock { 5; }
byCenterPointRadius = Circle.ByCenterPointRadius(radius=code_block)
radius = Circle.Radius(circle=byCenterPointRadius)
