# Dynamo graph WatchTree.dyn (Dynamo 2.15.0.5252)

watch = Watch()  # unwired: arg0
code_block = CodeBlock { 1; }
watch_2 = Watch(code_block)
code_block_2 = CodeBlock { "I'm a really long string that forms a single entry to a watch node and stuff"; }
watch_3 = Watch(code_block_2)
code_block_3 = CodeBlock()
# ---------- code_block_3.designscript (8 lines) ----------
[
	"Hi",
	"Hola",
	"Kia ora",
	"Privyet",
	"Salut",
	"Ciao"
];
# ----------------------------------------
watch_4 = Watch(code_block_3)
code_block_4 = CodeBlock { 1; }
color_rangex = ColorRange(value=code_block_4)  # unwired: colors, indices
string = StringInput("""line 1.
line 2.
line 3.

line 4.""")
watch_5 = Watch(string)
code_block_5 = CodeBlock { {"id":7888,"uid":"095a8563-6b2f-4961-b5d0-51d224508ff7","brand":"Budweiser","name":"Westmalle Trappist Tripel","style":"Stout","hop":"Willamette","yeast":"1099 - Whitbread Ale","malts":"Vienna","ibu":"45 IBU","alcohol":"9.6%","blg":"11.7°Blg"}; }
watch_6 = Watch(code_block_5)
