# Dynamo graph 02 List Lacing.dyn (Dynamo 1.0.1.1743)

# note: Longer series (10 elements)
code_block = CodeBlock { 0..9; }
code_block_2 = CodeBlock { 4; }
byCoordinates = Point.ByCoordinates(x=code_block, z=code_block_2)
# note: Shorter series (6 elements)
code_block_3 = CodeBlock { 0..5; }
byCoordinates_2 = Point.ByCoordinates(x=code_block_3)
# note: Longest Lacing
# As many lines are drawn as there are items in the longer list of input points.  When the node runs out of points in the shorter list, it will make as many copies of the last item as it needs to match with the ending items in the longest list.
# note: Tip: A node's lacing behavior is notated on the node with the small glyph at the bottom right corner.  If you don't see any glyph, the node does not lace.
byStartPointEndPoint = Line.ByStartPointEndPoint(startPoint=byCoordinates, endPoint=byCoordinates_2, lacing=Longest)
# note: LIST LACING
# Lacing is the logic a Dynamo node uses to match together items from different lists.  Most nodes in Dynamo allow you to choose how to combine lists of information by setting the "lacing behavior."
# In each of theses examples, there are two lists of points that are being passed into the Line.ByStartPointEndPoint node.  The node that makes the line must decide how many lines to draw and between which sets of points.
# Set the lacing behavior by right-clicking on a node that has two or more input ports and choosing "Lacing."
code_block_4 = CodeBlock { 0..9; }
code_block_5 = CodeBlock { -10; 4; }
byCoordinates_3 = Point.ByCoordinates(x=code_block_4, y=code_block_5.out0, z=code_block_5.out1)
code_block_6 = CodeBlock { 0..5; }
# note: Tip: Show the item index as a label in the background preview for any node that makes geometry.  Right-click and choose "Show Labels."
byCoordinates_4 = Point.ByCoordinates(x=code_block_6, y=code_block_5.out0)
# note: Shortest Lacing
# Only as many lines are drawn as there are items in the shortest input list.  Points "left over" in the longer list are disregarded.
byStartPointEndPoint_2 = Line.ByStartPointEndPoint(startPoint=byCoordinates_3, endPoint=byCoordinates_4)
code_block_7 = CodeBlock { 0..9; }
code_block_8 = CodeBlock { 10; 4; }
byCoordinates_5 = Point.ByCoordinates(x=code_block_7, y=code_block_8.out0, z=code_block_8.out1)
code_block_9 = CodeBlock { 0..5; }
byCoordinates_6 = Point.ByCoordinates(x=code_block_9, y=code_block_8.out0)
# note: Cross Product Lacing
# All possible combinations of pairings are made.  For 10 points in the longer list and 6 in the shorter list, there will be 10 x 6 = 60 lines that result.
byStartPointEndPoint_3 = Line.ByStartPointEndPoint(startPoint=byCoordinates_5, endPoint=byCoordinates_6, lacing=CrossProduct)
# note: Resulting lines will be stored in a nested list, either 6 lists of 10 lines or 10 lists of 6 lines, depending on which list is specified first.
watch = Watch(byStartPointEndPoint_3)
