# Dynamo graph 03 Attractor Point.dyn (Dynamo 0.7.2.2910)

number = DoubleInput(1..50..5)
number_2 = DoubleInput(0)
byCoordinates = Point.ByCoordinates(number, number, number_2, lacing=CrossProduct)
flatten = Flatten(byCoordinates)
X = Point.X(flatten)
Y = Point.Y(flatten)
number_slider = DoubleSlider(37.53785695, range=-10..60)
number_slider_2 = DoubleSlider(26.38062913, range=-10..60)
byCoordinates_2 = Point.ByCoordinates(number_slider, number_slider_2, number_2, lacing=Longest)
distanceTo = Geometry.DistanceTo(flatten, byCoordinates_2, lacing=Longest)
code_block = CodeBlock(x=distanceTo) { x/2; }
byCoordinates_3 = Point.ByCoordinates(X, Y, code_block)
code_block_2 = CodeBlock(x=distanceTo) { x/15; }
byPointsRadius = Cylinder.ByPointsRadius(flatten, byCoordinates_3, code_block_2)
