# Dynamo graph 05 Write To Excel.dyn (Dynamo 2.0.0.3273)

string = StringInput("")
string_2 = StringInput("helix")
number = DoubleInput(0)
number_slider = DoubleSlider(1.793, range=0..5 step 0.1)
code_block = CodeBlock(numCircles=number_slider) { 0..(360*numCircles)..10; }
cos = Math.Cos(code_block, lacing=Longest)
sin = Math.Sin(code_block, lacing=Longest)
code_block_2 = CodeBlock(x=code_block) { x/100; }
byCoordinates = Point.ByCoordinates(x=cos, y=sin, z=code_block_2, lacing=Longest)
code_block_3 = CodeBlock(pt=byCoordinates) { {pt.X,pt.Y,pt.Z}; }
transpose = List.Transpose(code_block_3)
writeToFile = Excel.WriteToFile(filePath=string, sheetName=string_2, startRow=number, startCol=number, data=transpose)
