# Dynamo graph 06 Read from CSV.dyn (Dynamo 0.8.0.1097)

file_path = Filename("C:\Users\t_yanz\Desktop\20140901 Colin's Workshop Files\20140901 Colin's Workshop Files\01 Dynamo Basics\ecaade.csv")
# note: Browse to the file "eCAADe.csv"
importFromCSV = ImportFromCSV(file_path)
code_block = CodeBlock(ls=importFromCSV) { ls[0]; ls[1]; ls[2]; }
byCoordinates = Point.ByCoordinates(x=code_block.out0, y=code_block.out1, z=code_block.out2)
byPoints = NurbsCurve.ByPoints(byCoordinates)
