# Dynamo graph WorkflowtestForCSV.dyn (Dynamo 0.8.1.1791)

# note: Browse to the file "eCAADe.csv"

file_path = Filename(".\ecaade.csv")
importFromCSV = ImportFromCSV(file_path)
code_block = CodeBlock(ls=importFromCSV) { ls[0]; ls[1]; ls[2]; }
byCoordinates = Point.ByCoordinates(x=code_block.out0, y=code_block.out1, z=code_block.out2)
code_block_2 = CodeBlock { -3; }
byPoints = NurbsCurve.ByPoints(byCoordinates, code_block_2)
