# Dynamo graph 01_StructuralFraming.dyn (Dynamo 0.7.0.3446)

# note: Select curve from Revit
# note: Run this graph the .RVT file in the Samples folder.
select_model_element = DSModelElementSelection()  # 1 picked in the model
curve = CurveElement.Curve(select_model_element)
integer_slider = IntegerSlider(9, range=2..10)
code_block = CodeBlock(x=integer_slider) { 0..1..#x; }
pointAtParameter = Curve.PointAtParameter(curve, code_block, lacing=CrossProduct)
select_model_element_2 = DSModelElementSelection()  # 1 picked in the model
curve_2 = CurveElement.Curve(select_model_element_2)
pointAtParameter_2 = Curve.PointAtParameter(curve_2, code_block)
byStartPointEndPoint = Line.ByStartPointEndPoint(pointAtParameter, pointAtParameter_2)
levels = Levels(index=0)
ZAxis = Vector.ZAxis()
beam = StructuralType.Beam()
structural_framing_types = StructuralFramingTypes(index=0)
byCurveLevelUpVectorAndType = StructuralFraming.ByCurveLevelUpVectorAndType(byStartPointEndPoint, levels, ZAxis, beam, structural_framing_types)
