# Dynamo graph 03_Adaptive Component Placement 2.dyn (Dynamo 0.7.2.40823)

# note: Select curve from Revit
# note: Run this graph the .RVT file in the Samples folder.
select_model_element = DSModelElementSelection()  # 1 picked in the model
select_model_element_2 = DSModelElementSelection()  # 1 picked in the model
select_model_element_3 = DSModelElementSelection()  # 1 picked in the model
create_list = List.Create(select_model_element, select_model_element_2, select_model_element_3)
curve = CurveElement.Curve(create_list)
firstItem = List.FirstItem(curve)
integer_slider = IntegerSlider(9, range=2..10)
code_block = CodeBlock(x=integer_slider) { 0..1..#x; }
pointAtParameter = Curve.PointAtParameter(firstItem, code_block, lacing=CrossProduct)
tangentAtParameter = Curve.TangentAtParameter(firstItem, code_block)
byOriginNormal = Plane.ByOriginNormal(pointAtParameter, tangentAtParameter)
intersect = Geometry.Intersect(byOriginNormal, curve, lacing=CrossProduct)
code_block_2 = CodeBlock { 1; }
flatten = List.Flatten(arg1=code_block_2)
map = List.Map(intersect, flatten)
family_types = FamilyTypes(index=2)
byPoints = AdaptiveComponent.ByPoints(map, family_types)
