# Dynamo graph 04_ImportSolid.dyn (Dynamo 0.7.2.40823)

# note: Select curve from Revit
# note: Run this graph the .RVT file in the Samples folder.
select_model_element = DSModelElementSelection()  # 1 picked in the model
select_model_element_2 = DSModelElementSelection()  # 1 picked in the model
select_model_element_3 = DSModelElementSelection()  # 1 picked in the model
create = List.Create(select_model_element, select_model_element_2, select_model_element_3)
curve = CurveElement.Curve(create)
code_block = CodeBlock { 0..1..#9; }
pointAtParameter = Curve.PointAtParameter(curve, code_block, lacing=CrossProduct)
transpose = List.Transpose(pointAtParameter)
byPoints = NurbsCurve.ByPoints(transpose)
double_slider = DoubleSlider(3, range=0..5)
extendStart = Curve.ExtendStart(byPoints, double_slider)
extendEnd = Curve.ExtendEnd(extendStart, double_slider)
byLoft = Surface.ByLoft(extendEnd)
double_slider_2 = DoubleSlider(0.3126339669, range=0..1)
thicken = Surface.Thicken(byLoft, double_slider_2)
byGeometries = ImportInstance.ByGeometries(thicken)
