# Dynamo graph 05_PlaceFamiliesByLevel_Set Parameters.dyn (Dynamo 0.7.2.40823)

family_types = FamilyTypes(index=41)
code_block = CodeBlock { -30; 30; 10; }
number_range = NumberRange(code_block.out0, code_block.out1, code_block.out2, lacing=Longest)
code_block_2 = CodeBlock { -30..-50..#3; }
byCoordinates = Point.ByCoordinates(number_range, code_block_2, lacing=CrossProduct)
flatten = Flatten(byCoordinates)
levels = Levels(index=3)
byPointAndLevel = FamilyInstance.ByPointAndLevel(family_types, flatten, levels)
string = StringInput("Mark")
number = DoubleInput(1)
count = Count(byPointAndLevel)
number_sequence = NumberSeq(number, count, number, lacing=Longest)
fromObject = String.FromObject(number_sequence)
setParameterByName = Element.SetParameterByName(byPointAndLevel, string, fromObject)
