# Dynamo graph 06_Color.dyn (Dynamo 0.7.2.40823)

# note: Get Walls
select_model_elements = DSModelElementsSelection()  # 10 picked in the model
number = DoubleInput(0)
number_2 = DoubleInput(255)
byARGB = Color.ByARGB(number, number, number_2, number, lacing=Longest)
number_3 = DoubleInput(0)
number_4 = DoubleInput(255)
byARGB_2 = Color.ByARGB(number_3, number_4, number_3, number_3, lacing=Longest)
geometry = Element.Geometry(select_model_elements)
flatten = Flatten(geometry)
area = Solid.Area(flatten)
# note: get highest value
# note: normalize at highest value
maximumItem = List.MaximumItem(area)
div = area / maximumItem
# note: set color range
color_range = ColorRange(byARGB, byARGB_2, div)
overrideColorInView = Element.OverrideColorInView(select_model_elements, color_range, lacing=Longest)
number_5 = DoubleInput(100)
# note: identify panels within a tolerance
# note: or
formula = Formula("if(x>y,1,0)", x=area, y=number_5, lacing=Longest)
code_block = CodeBlock(x=area, y=number_5) { x > y ? 1 : 0; }
gt = area > number_5
code_block_2 = CodeBlock { 1; 0; }
if_ = If(gt, code_block_2.out0, code_block_2.out1)
