# Dynamo graph 02 Ellipse Tower v2.dyn (Dynamo 0.7.2.40823)

total_building_height = DoubleSlider(50, range=0..100)
code_block = CodeBlock(height=total_building_height) { Point.ByCoordinates(0,0,{0,30,height}); {10,8,12}; {20,12,17}; }
byOriginRadii = Ellipse.ByOriginRadii(code_block.out0, code_block.out1, code_block.out2)
byLoft = Surface.ByLoft(byOriginRadii)
code_block_2 = CodeBlock { 0; }
code_block_3 = CodeBlock()
# ---------- code_block_3.designscript (2 lines) ----------
// first floor height
8;
# ----------------------------------------
code_block_4 = CodeBlock(secondFloor=code_block_3, height=total_building_height) { secondFloor..height..3.5; }
# note: Floor elevations
addItemToFront = List.AddItemToFront(code_block_2, code_block_4)
byCoordinates = Point.ByCoordinates(arg2=addItemToFront)
ZAxis = Vector.ZAxis()
byOriginNormal = Plane.ByOriginNormal(byCoordinates, ZAxis)
intersect = Geometry.Intersect(byLoft, byOriginNormal)
# note: Ellipses
flatten = Flatten(intersect)
code_block_5 = CodeBlock { 0..1..#40; }
pointAtParameter = Curve.PointAtParameter(flatten, code_block_5, lacing=CrossProduct)
# note: Approximate curve by many-sided polygons
byPoints = PolyCurve.ByPoints(pointAtParameter)
floor_types = FloorTypes(index=4)
code_block_6 = CodeBlock { "G"; }
# note: Make levels
count = List.Count(addItemToFront)
code_block_7 = CodeBlock(numFloors=count) { 2..numFloors; }
fromObject = String.FromObject(code_block_7)
addItemToFront_2 = List.AddItemToFront(code_block_6, fromObject)
code_block_8 = CodeBlock { "Lvl "; }
concat = String.Concat(code_block_8)
map = List.Map(addItemToFront_2, concat)
byElevationAndName = Level.ByElevationAndName(addItemToFront, map)
byOutlineTypeAndLevel = Floor.ByOutlineTypeAndLevel(byPoints, floor_types, byElevationAndName)
code_block_9 = CodeBlock { 10; 15; }
uv_quads_on_surface = Custom[UV Quads on Surface](u=code_block_9.out0, v=code_block_9.out1)  # Create groups of 4 points from a grid on a surface
family_types = FamilyTypes(index=19)
byPoints_2 = AdaptiveComponent.ByPoints(uv_quads_on_surface, family_types)
# note: Steal logic from the package "UV Quads on Surface" to adjust panels by floor positions.
panels_around_tower = IntegerSlider(10, range=0..20)
code_block_10 = CodeBlock(panels=panels_around_tower) { 0..1..#panels; }
pointAtParameter_2 = Curve.PointAtParameter(flatten, code_block_10, lacing=CrossProduct)
transpose = List.Transpose(pointAtParameter_2)
code_block_11 = CodeBlock(vVal=transpose) { vLen = List.Count(vVal); vVal[0..(vLen-2)]; vVal[1..(vLen-1)]; }
code_block_12 = CodeBlock(uVal=pointAtParameter_2) { uLen = List.Count(uVal); uVal[0..(uLen-2)]; uVal[1..(uLen-1)]; }
code_block_13 = CodeBlock(insideLen=code_block_12.uLen) { 0..(insideLen-2); }
getItemAtIndex = List.GetItemAtIndex(arg1=code_block_13)
map_2 = List.Map(code_block_11.out2, getItemAtIndex)
flatten_2 = Flatten(map_2)
code_block_14 = CodeBlock(insideLen=code_block_11.vLen) { 1..(insideLen-1); }
getItemAtIndex_2 = List.GetItemAtIndex(arg1=code_block_14)
map_3 = List.Map(code_block_12.out2, getItemAtIndex_2)
transpose_2 = List.Transpose(map_3)
flatten_3 = Flatten(transpose_2)
code_block_15 = CodeBlock(insideLen=code_block_12.uLen) { 1..(insideLen-1); }
getItemAtIndex_3 = List.GetItemAtIndex(arg1=code_block_15)
map_4 = List.Map(code_block_11.out1, getItemAtIndex_3)
flatten_4 = Flatten(map_4)
code_block_16 = CodeBlock(insideLen=code_block_11.vLen) { 0..(insideLen-2); }
getItemAtIndex_4 = List.GetItemAtIndex(arg1=code_block_16)
map_5 = List.Map(code_block_12.out1, getItemAtIndex_4)
transpose_3 = List.Transpose(map_5)
flatten_5 = Flatten(transpose_3)
create = List.Create(flatten_2, flatten_3, flatten_4, flatten_5)
transpose_4 = List.Transpose(create)
family_types_2 = FamilyTypes(index=19)
byPoints_3 = AdaptiveComponent.ByPoints(transpose_4, family_types_2)
code_block_17 = CodeBlock { 255; }
byARGB = Color.ByARGB(arg3=code_block_17)
byARGB_2 = Color.ByARGB(arg1=code_block_17)
code_block_18 = CodeBlock { "deflection"; }
getParameterValueByName = Element.GetParameterValueByName(byPoints_3, code_block_18)
formula = Formula("x", x=getParameterValueByName)
code_block_19 = CodeBlock { 0; 1; }
remapRange = Math.RemapRange(formula, code_block_19.out0, code_block_19.out1)
color_range = ColorRange(byARGB, byARGB_2, remapRange)
overrideColorInView = Element.OverrideColorInView(byPoints_3, color_range)
file_path = Filename("C:\Users\mccronc\Desktop\colors")
code_block_20 = CodeBlock { "colours"; 0; }
alpha = Color.Alpha(color_range)
red = Color.Red(color_range)
green = Color.Green(color_range)
blue = Color.Blue(color_range)
create_2 = List.Create(alpha, red, green, blue)
transpose_5 = List.Transpose(create_2)
write = Excel.Write(file_path, code_block_20.out0, code_block_20.out1, code_block_20.out1, transpose_5)
toString = ToString()
map_6 = List.Map(color_range, toString)
