# Dynamo graph 03 Ellipse Tower v3.dyn (Dynamo 0.7.2.40823)

total_building_height = DoubleSlider(50, range=0..100)
code_block = CodeBlock(height=total_building_height) { Point.ByCoordinates(0,0,{0,30,height}); {10,8,12}; {20,12,17}; }
byOriginRadii = Ellipse.ByOriginRadii(code_block.out0, code_block.out1, code_block.out2)
byLoft = Surface.ByLoft(byOriginRadii)
code_block_2 = CodeBlock { 0; }
code_block_3 = CodeBlock()
# ---------- code_block_3.designscript (2 lines) ----------
// first floor height
8;
# ----------------------------------------
code_block_4 = CodeBlock(secondFloor=code_block_3, height=total_building_height) { secondFloor..height..3.5; }
# note: Floor elevations
addItemToFront = List.AddItemToFront(code_block_2, code_block_4)
byCoordinates = Point.ByCoordinates(arg2=addItemToFront)
ZAxis = Vector.ZAxis()
byOriginNormal = Plane.ByOriginNormal(byCoordinates, ZAxis)
intersect = Geometry.Intersect(byLoft, byOriginNormal)
# note: Ellipses
flatten = Flatten(intersect)
code_block_5 = CodeBlock { 0..1..#40; }
pointAtParameter = Curve.PointAtParameter(flatten, code_block_5, lacing=CrossProduct)
# note: Approximate curve by many-sided polygons
byPoints = PolyCurve.ByPoints(pointAtParameter)
floor_types = FloorTypes(index=4)
code_block_6 = CodeBlock { "G"; }
# note: Make levels
count = List.Count(addItemToFront)
code_block_7 = CodeBlock(numFloors=count) { 2..numFloors; }
fromObject = String.FromObject(code_block_7)
addItemToFront_2 = List.AddItemToFront(code_block_6, fromObject)
code_block_8 = CodeBlock { "Lvl "; }
concat = String.Concat(code_block_8)
map = List.Map(addItemToFront_2, concat)
byElevationAndName = Level.ByElevationAndName(addItemToFront, map)
byOutlineTypeAndLevel = Floor.ByOutlineTypeAndLevel(byPoints, floor_types, byElevationAndName)
code_block_9 = CodeBlock { 10; 15; }
# note: Place panels in Revit
uv_quads_on_surface = Custom[UV Quads on Surface](surface=byLoft, u=code_block_9.out0, v=code_block_9.out1)  # Create groups of 4 points from a grid on a surface
family_types = FamilyTypes(index=19)
byPoints_2 = AdaptiveComponent.ByPoints(uv_quads_on_surface, family_types)
# note: Navigate to "rainbow colors" in the samples folder
file_path = Filename("C:\Users\mccronc\Desktop\Dynamo eCAADe\03 Ellipse Tower\rainbowColors.jpg")
readImage = File.ReadImage(file_path, code_block_9.out0, code_block_9.out1)
chop = List.Chop(readImage, code_block_9.out0)
transpose = List.Transpose(chop)
flatten_2 = Flatten(transpose)
overrideColorInView = Element.OverrideColorInView(byPoints_2, flatten_2)
readImage_2 = File.ReadImage(file_path, code_block_9.out1, code_block_9.out0)
chop_2 = List.Chop(readImage_2, code_block_9.out0)
transpose_2 = List.Transpose(chop_2)
flatten_3 = Flatten(transpose_2)
