# Dynamo custom node UV Quads on Surface.dyf (Dynamo 0.7.0.16660)
# category: Geometry.Surface.Actions
# Create groups of 4 points from a grid on a surface

surface = Input()
u = Input()
code_block = CodeBlock(u=u) { 0..1..#u; }
v = Input()
code_block_2 = CodeBlock(v=v) { 0..1..#v; }
pointAtParameter = Surface.PointAtParameter(surface, code_block, code_block_2, lacing=CrossProduct)
transpose = List.Transpose(pointAtParameter)
code_block_3 = CodeBlock(vVal=transpose) { vLen = List.Count(vVal); vVal[0..(vLen-2)]; vVal[1..(vLen-1)]; }
code_block_4 = CodeBlock(uVal=pointAtParameter) { uLen = List.Count(uVal); uVal[0..(uLen-2)]; uVal[1..(uLen-1)]; }
code_block_5 = CodeBlock(insideLen=code_block_4.uLen) { 0..(insideLen-2); }
getItemAtIndex = List.GetItemAtIndex(arg1=code_block_5)
map = List.Map(code_block_3.out2, getItemAtIndex)
flatten = Flatten(map)
code_block_6 = CodeBlock(insideLen=code_block_3.vLen) { 1..(insideLen-1); }
getItemAtIndex_2 = List.GetItemAtIndex(arg1=code_block_6)
map_2 = List.Map(code_block_4.out2, getItemAtIndex_2)
transpose_2 = List.Transpose(map_2)
flatten_2 = Flatten(transpose_2)
code_block_7 = CodeBlock(insideLen=code_block_4.uLen) { 1..(insideLen-1); }
getItemAtIndex_3 = List.GetItemAtIndex(arg1=code_block_7)
map_3 = List.Map(code_block_3.out1, getItemAtIndex_3)
flatten_3 = Flatten(map_3)
code_block_8 = CodeBlock(insideLen=code_block_3.vLen) { 0..(insideLen-2); }
getItemAtIndex_4 = List.GetItemAtIndex(arg1=code_block_8)
map_4 = List.Map(code_block_4.out1, getItemAtIndex_4)
transpose_3 = List.Transpose(map_4)
flatten_4 = Flatten(transpose_3)
create = List.Create(flatten, flatten_2, flatten_3, flatten_4)
transpose_4 = List.Transpose(create)
Quad_groups = Output(transpose_4)
