# Dynamo graph Panels_CodeBlocks.dyn (Dynamo 0.7.2.32651)

code_block = CodeBlock()
# ---------- code_block.designscript (12 lines) ----------
pts1 = {Point.ByCoordinates(15,3),
Point.Origin(),
Point.ByCoordinates(-8,-7)};

pts2 = {Point.ByCoordinates(15,-1,15),
Point.ByCoordinates(2,3,15),
Point.ByCoordinates(-10,-7,15)};

crv1 = NurbsCurve.ByPoints(pts1);
crv2 = NurbsCurve.ByPoints(pts2);

Surface.ByLoft({crv1,crv2});
# ----------------------------------------
u = IntegerSlider(6, range=0..40)
v = IntegerSlider(3, range=0..40)
uv_quads_on_surface = Custom[UV Quads on Surface](surface=code_block.out4, u=u, v=v)  # Create groups of 4 points from a grid on a surface
family_types = FamilyTypes(index=86)
file_path = Filename("C:\Users\mccronc\Desktop\Dynamo eCAADe\05 Code blocks\black-and-white-photography1.jpg")
code_block_2 = CodeBlock(quads=uv_quads_on_surface, type=family_types, filePath=file_path, u=u, v=v)
# ---------- code_block_2.designscript (5 lines) ----------
elem = AdaptiveComponent.ByPoints(quads, type);

colors = File.ReadImage(filePath, u-1, v-1);

elem.OverrideColorInView(colors);
# ----------------------------------------
