# Dynamo graph Panels_Nodes.dyn (Dynamo 0.7.2.32651)

code_block = CodeBlock { 15; 3; }
byCoordinates = Point.ByCoordinates(code_block.out0, code_block.out1)
origin = Point.Origin()
code_block_2 = CodeBlock { -8; -7; }
byCoordinates_2 = Point.ByCoordinates(code_block_2.out0, code_block_2.out1)
create = List.Create(byCoordinates, origin, byCoordinates_2)
byPoints = NurbsCurve.ByPoints(create)
code_block_3 = CodeBlock { 15; -1; 15; }
byCoordinates_3 = Point.ByCoordinates(code_block_3.out0, code_block_3.out1, code_block_3.out2)
code_block_4 = CodeBlock { 2; 3; 15; }
byCoordinates_4 = Point.ByCoordinates(code_block_4.out0, code_block_4.out1, code_block_4.out2)
code_block_5 = CodeBlock { -10; -7; 15; }
byCoordinates_5 = Point.ByCoordinates(code_block_5.out0, code_block_5.out1, code_block_5.out2)
create_2 = List.Create(byCoordinates_3, byCoordinates_4, byCoordinates_5)
byPoints_2 = NurbsCurve.ByPoints(create_2)
create_3 = List.Create(byPoints, byPoints_2)
byLoft = Surface.ByLoft(create_3)
u = IntegerSlider(25, range=0..40)
v = IntegerSlider(20, range=0..40)
uv_quads_on_surface = Custom[UV Quads on Surface](surface=byLoft, u=u, v=v)  # Create groups of 4 points from a grid on a surface
family_types = FamilyTypes(index=86)
byPoints_3 = AdaptiveComponent.ByPoints(uv_quads_on_surface, family_types)
file_path = Filename("C:\Users\mccronc\Desktop\black-and-white-photography1.jpg")
code_block_6 = CodeBlock { 1; }
sub = u - code_block_6
sub_2 = v - code_block_6
readImage = File.ReadImage(file_path, sub, sub_2, lacing=Longest)
overrideColorInView = Element.OverrideColorInView(byPoints_3, readImage)
