# Dynamo graph Basket1.dyn (Dynamo 0.7.1.25189)

origin = Point.Origin()
hoop_array_radius = DoubleSlider(3.17, range=0..10)
byCenterPointRadius = Circle.ByCenterPointRadius(origin, hoop_array_radius)
number_of_hoops = IntegerSlider(12, range=0..30)
# note: Remember to account for the fact that the point at parameter = 0 will be the same as the point at parameter = 1 because a circle is a closed curve.
code_block = CodeBlock(numHoops=number_of_hoops) { 0..1..#(numHoops+1); }
# note: All curves are "parameterized" from 0 to 1, with 0 as the start point and 1 as the end point.
pointAtParameter = Curve.PointAtParameter(byCenterPointRadius, code_block)
# note: This makes sure we have no redundant points. It removes the start point at parameter = 0.
restOfItems = List.RestOfItems(pointAtParameter)
hoop_radius = DoubleSlider(9.018, range=0..20)
# note: Outer circle
byCenterPointRadius_2 = Circle.ByCenterPointRadius(restOfItems, hoop_radius)
# note: Basket #1
# Boolean Difference and Transformations.
# See the blog post at
# http://DynamoBIM.org/geom101/
# - Colin McCrone, Autodesk
hoop_width = DoubleSlider(1.5, range=0..10)
byCoordinates = Vector.ByCoordinates(arg2=hoop_width)
extrudeAsSolid = Curve.ExtrudeAsSolid(byCenterPointRadius_2, byCoordinates)
hoop_thickness = DoubleSlider(0.125, range=0..1)
code_block_2 = CodeBlock(rad=hoop_radius, thickness=hoop_thickness) { rad-thickness; }
# note: Inner circle
byCenterPointRadius_3 = Circle.ByCenterPointRadius(restOfItems, code_block_2)
extrudeAsSolid_2 = Curve.ExtrudeAsSolid(byCenterPointRadius_3, byCoordinates)
difference = Solid.Difference(extrudeAsSolid, extrudeAsSolid_2, lacing=Longest)
origin_2 = Point.Origin()
# note: This is a shortcut that works this simply because the basket is centered at the origin.  Point.AsVector takes the x, y, and z coordinates of the point and makes a vector (from the origin) with the same values.  This is used as a the radial vector.
# note: Tip: Right click on any of these nodes that make or contain geometry to see the intermediate steps.
asVector = Point.AsVector(restOfItems)
tilt_tangential = DoubleSlider(12, range=-90..90)
# note: Rotate hoop about the radius of the central circle.
rotate = Geometry.Rotate(difference, origin_2, asVector, tilt_tangential)
# note: The radial vector rotated by 90° is the tangent vector.  This is also a shortcut that works because the curve is a circle.  (It wouldn't work so well if we were dealing with arbitrary curves, and we would have to us Curve.TangentAtParameter instead.)
code_block_3 = CodeBlock { -90; }
rotate_2 = Vector.Rotate(asVector, byCoordinates, code_block_3)
tilt_radial = DoubleSlider(22.072, range=-90..90)
# note: The origin for each of these transformations, about the tangent of the central circle, is different, whereas the origins for the first transformation were all the same.
# note: Rotate hoop about the tangent vector. (Tilts it up.)
rotate_3 = Geometry.Rotate(rotate, restOfItems, rotate_2, tilt_radial)
