# Dynamo graph Basket2.dyn (Dynamo 0.7.1.25189)

XAxis = Vector.XAxis()
ZAxis = Vector.ZAxis()
# note: Basket #2
# Points, PolyCurves, and Extrusion.
# See the blog post at
# http://DynamoBIM.org/geom101/
# - Colin McCrone, Autodesk
number_of_sides = IntegerSlider(9, range=0..10)
code_block = CodeBlock(numSides=number_of_sides) { 0..(360 - 360/numSides)..#numSides; }
rotate = Vector.Rotate(XAxis, ZAxis, code_block)
number_of_rotations = IntegerSlider(7, range=0..20)
width_of_coil = DoubleSlider(1, range=0..2)
# note: See more about making series in the help files.
# Help/Samples/Core/CoreRangeSynax
width_of_kerf = DoubleSlider(0.2, range=0..0.5)
center_offset = DoubleSlider(4, range=0..10)
code_block_2 = CodeBlock(numRotations=number_of_rotations, widthCoil=width_of_coil, widthKerf=width_of_kerf, centerOffset=center_offset) { seq = 0..#(numRotations+1)..(widthCoil + widthKerf); seq + centerOffset; seq + centerOffset + widthKerf; }
# note: Rotate the x-axis vector
# by all these angles.
scale = Vector.Scale(rotate, code_block_2.out1, lacing=CrossProduct)
asPoint = Vector.AsPoint(scale)
transpose = List.Transpose(asPoint)
deconstruct = List.Deconstruct(transpose)
flatten = Flatten(deconstruct.out1)
# note: Get everything but the last element of the list. The outer-most spiral doesn't need the points on the other side of the kerf (gap, in plan, between rings).
# See: Help/Samples/Core/CoreCodeBlocks
ZAxis_2 = Vector.ZAxis()
height = DoubleSlider(6.5, range=0..10)
code_block_3 = CodeBlock(height=height, numSides=number_of_sides, numCoils=number_of_rotations) { 0..height..#((numSides+1)*numCoils); }
# note: Create the series of vectors in the vertical direction (Z) to move each of the points arrayed in a spiral up, a small bit at a time.
scale_2 = Vector.Scale(ZAxis_2, code_block_3)
add = Point.Add(flatten, scale_2)
firstItem = List.FirstItem(add)
# note: Bottom
addItemToEnd = List.AddItemToEnd(firstItem, deconstruct.out0)
boolean = BoolSelector(true)
byPoints = PolyCurve.ByPoints(addItemToEnd, boolean)
join = List.Join()
code_block_4 = CodeBlock { 0..1; 1; }
# note: Outside of spiral
# note: The bottom, to be complete, needs just one more point, the first of the outside of the spiral.
sublists = List.Sublists(add, code_block_4.out0, code_block_4.out1)
# note: Use cross-product lacing to multiply every vector by every distance.
# See: Help/Samples/Core/ListLacing
scale_3 = Vector.Scale(rotate, code_block_2.out2, lacing=CrossProduct)
# note: You can use vectors to "scale" them by multiplying them by numbers.  Now that we've done this, we really need just points, so we can convert them directly to more physical points. You could also do this at the very end if you wanted.
asPoint_2 = Vector.AsPoint(scale_3)
# note: Change the list structure so vectors to points are arrayed in lists of rings instead of lists of radii. Now the first list is the first ring of points, etc. Use "Preview" and "Show Labels" for this node and the previos node to see the difference in the list ordering.
transpose_2 = List.Transpose(asPoint_2)
# note: The first ring ("first") is special because it defines the base. All other rings ("rest") are part of the spiral and can be treated together.
code_block_5 = CodeBlock(list=transpose_2) { list[0..(List.Count(list)-2)]; }
# note: Now that everything is in the right order and separated correctly, flatten the list so the points are arrayed in one continual spiral.  Right-click and use "Show Labels" to see.
flatten_2 = Flatten(code_block_5)
# note: Move these points up by "adding a vector"
add_2 = Point.Add(flatten_2, scale_2)
code_block_6 = CodeBlock { 0..1; 1; }
# note: Inside of spiral
# note: Chop the list of points in the spiral up into overlapping groups of two, to describe each segment individually.
sublists_2 = List.Sublists(add_2, code_block_6.out0, code_block_6.out1)
reverse = List.Reverse()
# note: Reverse the order of each of the sublists for one side of the spiral.
# See: Help/Samples/Core/CorePassingFunctions
# note: Smash the two lists together so that each new list of 4 points describes a loop for each spiral segment.
map = List.Map(sublists_2, reverse)
combine = List.Combine(join, sublists, map)
# note: Get everything but the last element of the list.  (Same as used earlier, just copied and pasted.) The last list only has 2 points in it, and is a left-over from the earlier process.
code_block_7 = CodeBlock(list=combine) { list[0..(List.Count(list)-2)]; }
# note: Make a closed polycurve for the base.
# note: Make a closed polycurve for each spiral segment
byPoints_2 = PolyCurve.ByPoints(code_block_7, boolean)
# note: Make one list of all polycurves. No need to keep them separate anymore.
addItemToFront = List.AddItemToFront(byPoints, byPoints_2)
wood_thickness = DoubleSlider(0.3, range=0..0.5)
byCoordinates = Vector.ByCoordinates(arg2=wood_thickness)
# note: In one move, extrude the polycurves into individual solids.
extrudeAsSolid = Curve.ExtrudeAsSolid(addItemToFront, byCoordinates)
# note: Optional. Connect this node to join all of the individual solids into one solid.
unionAll = Solid.UnionAll()
