# Dynamo graph Basket3.dyn (Dynamo 0.7.2.40823)

# note: Stiches together the points from the plane/ellipse intersections with the origin to make several list of 5 points.

# note: The two rows of nodes are identical--they could be collapsed into a custom node that is simply used twice.  Each chain of nodes makes a complete set of weaves for the basket, but based on the inputs, the weaves are opposite sets.  Logic at the very end of this chain then chooses weaves alternately from each set so that the weaves have an every/other pattern vertically.
# note: This is a technique to weave together two lists in an every/other pattern without using a loop (as in Python).
# note: 1. Stack the lists together
create = List.Create()
join = List.Join()
create_2 = List.Create()
# note: A code block can be used to collapse several nodes into one, smaller set of expressions.  This code block simply makes two ellipses.
code_block = CodeBlock()
# ---------- code_block.designscript (5 lines) ----------
p1 = Point.ByCoordinates(0,0,1.5);
p2 = Point.ByCoordinates(0,0,5);

Ellipse.ByOriginRadii(p1,5,8);
Ellipse.ByOriginRadii(p2,7,10);
# ----------------------------------------
origin = Point.Origin()
XAxis = Vector.XAxis()
ZAxis = Vector.ZAxis()
# note: Basket #3
# Intersection, Loft, Sweep, and Thicken.
# See the blog post at
# http://DynamoBIM.org/geom101/
# - Colin McCrone, Autodesk
number_of_vertical_pieces = IntegerSlider(5, range=2..20)
code_block_2 = CodeBlock(numVerts=number_of_vertical_pieces) { (180/numVerts)..#numVerts..(180/numVerts); }
# note: Tip: Right-click on any node that makes, contains, or operates on geomery and choose "Preview" to visualize the data in the background preview.
rotate = Vector.Rotate(XAxis, ZAxis, code_block_2)
byOriginNormal = Plane.ByOriginNormal(origin, rotate)
intersect = Geometry.Intersect(code_block.out3, byOriginNormal)
firstItem = List.FirstItem()
map = List.Map(intersect, firstItem)
# note: Use a plane to intersect with the curves to make sure the basket staves (or "spokes") are straigt.
intersect_2 = Geometry.Intersect(code_block.out2, byOriginNormal)
firstItem_2 = List.FirstItem()
map_2 = List.Map(intersect_2, firstItem_2)
# note: Put the single item (the origin) in a list--a list containing just one item--so that it can be treated similarly with the other lists of points.
create_3 = List.Create(origin)
lastItem = List.LastItem()
map_3 = List.Map(intersect_2, lastItem)
lastItem_2 = List.LastItem()
# note: This set of nodes gets the first and last items of each sublist.  (That's what the List.Map component does--MAP the function "get first" or "get last" to the sublists.)
map_4 = List.Map(intersect, lastItem_2)
laceLongest = List.LaceLongest(create_2, map, map_2, create_3, map_3, map_4)
# note: These will be the basic construction lines for the basket.
# note: Having the basket staves (or "spokes") continue through the center to the other sides has two benefits: (1) there will always be an even number of staves around which the weaves must pass, and (2) this ensures that the bottom of the basket will be smooth and not pointed, if the tangents of separate curves do not perfectly align.
byPoints = NurbsCurve.ByPoints(laceLongest)
number_of_weaves = IntegerSlider(4, range=0..10)
weave_bottom_offset = DoubleSlider(0.149, range=0..0.5)
# note: For more on making series, see:
# Help/Samples/Core/CoreRangeSyntax
code_block_3 = CodeBlock(numWeaves=number_of_weaves, offset=weave_bottom_offset) { halfWidth = 1/(4*numWeaves); halfWidth..(0.5 - offset)..#numWeaves; (0.5 + offset)..(1 - halfWidth)..#numWeaves; }
# note: This group of nodes creates line segments along the construction lines for the staves through which the weaves will pass.  This involves placing the line segments at the appropriate parameters along the stave construction lines and offsetting the lines to the inside and outside of the basket.
# note: This workflow is repeated for the other side of the line, below. Only one difference exists between the two sets of nodes: the order of the point inputs for determing the direction of the line segments.
pointAtParameter = Curve.PointAtParameter(byPoints, code_block_3.out1, lacing=CrossProduct)
tangentAtParameter = Curve.TangentAtParameter(byPoints, code_block_3.out1, lacing=CrossProduct)
# note: These series are the parameters at which to evaluate the construction lines for the basket.  One series for the first half of the line (one side of the basket) and the second series for the last half of  the line.
weave_width = DoubleSlider(1.097, range=0..5)
code_block_4 = CodeBlock(weaveWidth=weave_width) { weaveWidth/2; -weaveWidth/2; }
scale = Vector.Scale(tangentAtParameter, code_block_4.out0)
translate = Geometry.Translate(pointAtParameter, scale)
scale_2 = Vector.Scale(tangentAtParameter, code_block_4.out1)
# note: Note that the point order differs between this branch and the other.
translate_2 = Geometry.Translate(pointAtParameter, scale_2)
# note: Line segement, equal in length to the width of a weave, located along the stave construction curve where the weave will cross.  Aligned with the tangent of the stave curve.
byStartPointEndPoint = Line.ByStartPointEndPoint(translate, translate_2)
X = Point.X(pointAtParameter)
Y = Point.Y(pointAtParameter)
byCoordinates = Vector.ByCoordinates(X, Y)
# note: Radial vector, pointing from the center to the point on the basket, in the plane of the stave constuction curve.
normalized = Vector.Normalized(byCoordinates)
cross = Vector.Cross(normalized, tangentAtParameter)
# note: Sideways vector -- perpendicular to the plane of the basket stave construction curve.
# note: For more on finding the vectors perpendicular to the stave construction lines, pointing into or out of the basket, see the blog post at:
# http://DynamoBIM.org/geom101/
normalized_2 = Vector.Normalized(cross)
cross_2 = Vector.Cross(normalized_2, tangentAtParameter)
weave_in_out = DoubleSlider(0.311, range=0..0.5)
# note: Vector pointing perpendicularly INSIDE the basket
scale_3 = Vector.Scale(cross_2, weave_in_out)
# note: Vector pointing perpendicularly OUTSIDE the basket
reverse = Vector.Reverse(scale_3)
translate_3 = Geometry.Translate(byStartPointEndPoint, reverse)
transpose = List.Transpose(translate_3)
pointAtParameter_2 = Curve.PointAtParameter(byPoints, code_block_3.out2, lacing=CrossProduct)
tangentAtParameter_2 = Curve.TangentAtParameter(byPoints, code_block_3.out2, lacing=CrossProduct)
code_block_5 = CodeBlock(weaveWidth=weave_width) { weaveWidth/2; -weaveWidth/2; }
scale_4 = Vector.Scale(tangentAtParameter_2, code_block_5.out1)
translate_4 = Geometry.Translate(pointAtParameter_2, scale_4)
scale_5 = Vector.Scale(tangentAtParameter_2, code_block_5.out0)
translate_5 = Geometry.Translate(pointAtParameter_2, scale_5)
byStartPointEndPoint_2 = Line.ByStartPointEndPoint(translate_4, translate_5)
X_2 = Point.X(pointAtParameter_2)
Y_2 = Point.Y(pointAtParameter_2)
byCoordinates_2 = Vector.ByCoordinates(X_2, Y_2)
normalized_3 = Vector.Normalized(byCoordinates_2)
cross_3 = Vector.Cross(normalized_3, tangentAtParameter_2)
normalized_4 = Vector.Normalized(cross_3)
cross_4 = Vector.Cross(normalized_4, tangentAtParameter_2)
scale_6 = Vector.Scale(cross_4, weave_in_out)
reverse_2 = Vector.Reverse(scale_6)
translate_6 = Geometry.Translate(byStartPointEndPoint_2, reverse_2)
transpose_2 = List.Transpose(translate_6)
reverse_3 = List.Reverse(transpose_2)
# note: Outside lines
combine = List.Combine(join, transpose, reverse_3)
code_block_6 = CodeBlock { 2; 1; 0; }
takeEveryNthItem = List.TakeEveryNthItem(arg1=code_block_6.out0, arg2=code_block_6.out1)
# note: (1) Outside
map_5 = List.Map(combine, takeEveryNthItem)
# note: This set of nodes "weaves" together the offset line segments that the weave will pass through, alternately toward the inside of the basket, then the outside, for each stave.
join_2 = List.Join()
translate_7 = Geometry.Translate(byStartPointEndPoint, scale_3)
transpose_3 = List.Transpose(translate_7)
translate_8 = Geometry.Translate(byStartPointEndPoint_2, scale_6)
transpose_4 = List.Transpose(translate_8)
reverse_4 = List.Reverse(transpose_4)
# note: Inside lines
combine_2 = List.Combine(join_2, transpose_3, reverse_4)
code_block_7 = CodeBlock { 2; 1; 0; }
takeEveryNthItem_2 = List.TakeEveryNthItem(arg1=code_block_7.out0, arg2=code_block_7.out2)
# note: (0) Inside
map_6 = List.Map(combine_2, takeEveryNthItem_2)
combine_3 = List.Combine(create, map_5, map_6)
# note: 2. Transpose the lists to reorganize into pairs.
transpose_5 = List.Transpose()
map_7 = List.Map(combine_3, transpose_5)
# note: 3. Flatten the lists of pairs to make one list with inputs in an every/other order from the two original inputs.
code_block_8 = CodeBlock { 1; }
flatten = List.Flatten(arg1=code_block_8)
map_8 = List.Map(map_7, flatten)
# note: By creating two closed NURBS curves along the bottoms and tops of the line segments, it ensures that the weave will have a continuous appearance around the basket.
startPoint = Curve.StartPoint(map_8)
boolean = BoolSelector(true)
byPoints_2 = NurbsCurve.ByPoints(startPoint, boolean)
endPoint = Curve.EndPoint(map_8)
byPoints_3 = NurbsCurve.ByPoints(endPoint, boolean)
create_4 = List.Create(byPoints_2, byPoints_3)
transpose_6 = List.Transpose(create_4)
byLoft = Surface.ByLoft(transpose_6)
code_block_9 = CodeBlock { 2; 1; 0; }
# note: Combine every other element from each of these lists so that the final weave pattern has an every/other effect from the top to the bottom of the basket.
takeEveryNthItem_3 = List.TakeEveryNthItem(byLoft, code_block_9.out0, code_block_9.out1)
create_5 = List.Create()
takeEveryNthItem_4 = List.TakeEveryNthItem(arg1=code_block_7.out0, arg2=code_block_7.out1)
# note: (1) Inside
map_9 = List.Map(combine_2, takeEveryNthItem_4)
takeEveryNthItem_5 = List.TakeEveryNthItem(arg1=code_block_6.out0, arg2=code_block_6.out2)
# note: (0) Outside
map_10 = List.Map(combine, takeEveryNthItem_5)
combine_4 = List.Combine(create_5, map_9, map_10)
transpose_7 = List.Transpose()
map_11 = List.Map(combine_4, transpose_7)
code_block_10 = CodeBlock { 1; }
flatten_2 = List.Flatten(arg1=code_block_10)
map_12 = List.Map(map_11, flatten_2)
startPoint_2 = Curve.StartPoint(map_12)
boolean_2 = BoolSelector(true)
byPoints_4 = NurbsCurve.ByPoints(startPoint_2, boolean_2)
endPoint_2 = Curve.EndPoint(map_12)
byPoints_5 = NurbsCurve.ByPoints(endPoint_2, boolean_2)
create_6 = List.Create(byPoints_4, byPoints_5)
transpose_8 = List.Transpose(create_6)
byLoft_2 = Surface.ByLoft(transpose_8)
takeEveryNthItem_6 = List.TakeEveryNthItem(byLoft_2, code_block_9.out0, code_block_9.out2)
create_7 = List.Create(takeEveryNthItem_3, takeEveryNthItem_6)
flatten_3 = Flatten(create_7)
thickness = DoubleSlider(0.082, range=0..0.5)
thicken = Surface.Thicken(flatten_3, thickness)
lastItem_3 = List.LastItem(transpose_4)
endPoint_3 = Curve.EndPoint(lastItem_3)
closestPointTo = Geometry.ClosestPointTo(byPoints, endPoint_3)
firstItem_3 = List.FirstItem()
map_13 = List.Map(normalized_2, firstItem_3)
code_block_11 = CodeBlock(weaveWidth=weave_width) { weaveWidth/2; -weaveWidth/2; }
scale_7 = Vector.Scale(map_13, code_block_11.out0)
add = Point.Add(closestPointTo, scale_7)
scale_8 = Vector.Scale(map_13, code_block_11.out1)
add_2 = Point.Add(closestPointTo, scale_8)
byStartPointEndPoint_3 = Line.ByStartPointEndPoint(add, add_2)
create_8 = List.Create()
# note: This set of nodes creates the solid staves of the basket.
firstItem_4 = List.FirstItem(transpose_3)
# note: Since the stave construction lines protrude above the top of the topmost weave (by design, since the height of the top-most weave varies), this finds the closest point of each stave line to the top of the top weave, then reconstructs the stave construction line to include only the part to be made solid.
endPoint_4 = Curve.EndPoint(firstItem_4)
closestPointTo_2 = Geometry.ClosestPointTo(byPoints, endPoint_4)
laceLongest_2 = List.LaceLongest(create_8, closestPointTo_2, map_2, create_3, map_3, closestPointTo)
# note: New construction curves for the staves--the originals but cutoff at the appropriate points.
byPoints_6 = NurbsCurve.ByPoints(laceLongest_2)
# note: Since the profile of the curve will not change along the length of the stave, we can use the sweep function.
bySweep = Surface.BySweep(byStartPointEndPoint_3, byPoints_6)
thicken_2 = Surface.Thicken(bySweep, thickness)
