# Dynamo graph Core_Python.dyn (Dynamo 1.0.1.1743)

# note: PYTHON
# Dynamo supports Iron Python through one of two types of Python nodes. (A second type of Python node, not shown here, can read a script from an external file to be executed.)
# Double click on the Python node to see the script it contains.
# Input is contained in the IN array.  Output must be assigned to the OUT variable.  The output can be a single value or an array itself.

# note: Choose the sign for the operation
#     number < 0      subtract each
#     number = 0      0
#     number > 0      add each
# note: This example will add or subtract all of the items in a list.  It's inputs are a number, whose sign determines whether addition or subtraction is used, and a list of numbers.
integer_slider = IntegerSlider(1, range=-1..1 step 1)
# note: Create any list
code_block = CodeBlock { 0..10; }
watch = Watch(code_block)
python_script = Python(IN[0]=integer_slider, IN[1]=watch)
# ---------- python_script.python (31 lines) ----------
# Python script to find add or subtract a series of numbers. 

# Boiler-plate import statments included out-of-the-box
import clr
clr.AddReference('ProtoGeometry')
from Autodesk.DesignScript.Geometry import *

# The inputs to this node will be stored as a list in the IN variable.
sign = IN[0]  # -1 for subtract all, 0 for do nothing, 1 for add all
nums = IN[1]  # List of numbers to subtract or add

partials = [] # Empty array to contain partial sums or differences
result = 0    # Initialize the sum or difference to 0

# Loop through each item and add it or subtract it from the result.
for index in range(len(nums)):
	if sign > 0:
		result = result + nums[index]
		partials.append(result)
	elif sign == 0:
		partials.append(result)
		continue
	else:
		result = result - nums[index]
		partials.append(result)

# Assign the output to the OUT variable
#OUT = results  # Use this to output only the result.
OUT = []
OUT.append(result)
OUT.append(partials)
# ----------------------------------------
code_block_2 = CodeBlock { 1; }
getItemAtIndex = List.GetItemAtIndex(list=python_script, index=code_block_2)
# note: The series of partial results.
watch_2 = Watch(getItemAtIndex)
# note: The output from OUT is an array, where the first item is a single value and the second item is a list of values.  This data structure was specified in the Python definition itself.  Specifying an array allows you to send any number of outputs to the Dynamo graph.
code_block_3 = CodeBlock { 0; }
getItemAtIndex_2 = List.GetItemAtIndex(list=python_script, index=code_block_3)
# note: The total result.
watch_3 = Watch(getItemAtIndex_2)
# note: This Python example has no inputs.  It demonstrates how to create geometry using Dynamo's protogeometry library.  Since the Python node creates visible geometry, selecting it, just like any other node, will cause the geometry to be highlighted.
python_script_2 = Python()
# ---------- python_script_2.python (24 lines) ----------
import clr
clr.AddReference('ProtoGeometry')
from Autodesk.DesignScript.Geometry import *
#The inputs to this node will be stored as a list in the IN variable.
dataEnteringNode = IN

p1 = Point.ByCoordinates(0, 0, 0);
p2 = Point.ByCoordinates(-10, -10, -10);

l = Line.ByStartPointEndPoint(p1, p2);

pts = [
	Point.ByCoordinates(0, 0, 0),
	Point.ByCoordinates(10, 10, 0),
	Point.ByCoordinates(20, 0, 0),
	Point.ByCoordinates(30, 10, 0),
	Point.ByCoordinates(40, 0, 0) ]
	
spline = NurbsCurve.ByPoints(pts)

surf = spline.Extrude(Vector.ByCoordinates(0, 0, 1), 10)

#Assign your output to the OUT variable
OUT = [l, spline, surf]
# ----------------------------------------
code_block_4 = CodeBlock(output=python_script_2) { output[0]; output[1]; output[2]; }
# note: Tip: Use a Code Block to
# access certain items in a list.
watch_4 = Watch(code_block_4.out2)
watch_5 = Watch(code_block_4.out0)
watch_6 = Watch(code_block_4.out1)
