# Dynamo custom node Return List Or Single Value.dyf (Dynamo 0.7.1.29946)
# category: CAAD_RWTH.Lists
# If the list in input #1 only contains one item, only the first item of the list in input #2 will be returned.

list_2 = Input()  # "list #2"
list_1 = Input()  # "list #1"
code_block = CodeBlock(list2=list_2, list1=list_1)
# ---------- code_block.designscript (2 lines) ----------
returnsinglevalue = List.IsEmpty(list2) ? List.Empty : List.FirstItem(list2);
returnlist = List.Count(list1)>1 ? list2 : returnsinglevalue;
# ----------------------------------------
Output = Output(code_block.returnlist)  # ""
