# Dynamo graph Revit API via Python.dyn (Dynamo 0.7.2.40823)

select_model_elements = DSModelElementsSelection()  # 2 picked in the model
include_openings = BoolSelector(true)
include_shadows = BoolSelector(true)
include_embedded_walls = BoolSelector(true)
include_shared_embedded_inserts = BoolSelector(true)
# note: Get Inserts
python_script = Python(IN[0]=select_model_elements, IN[1]=include_openings, IN[2]=include_shadows, IN[3]=include_embedded_walls, IN[4]=include_shared_embedded_inserts)
# ---------- python_script.python (23 lines) ----------
import clr

clr.AddReference('RevitAPI')
from Autodesk.Revit.DB import *

clr.AddReference("RevitServices")
import RevitServices
from RevitServices.Persistence import DocumentManager

doc = DocumentManager.Instance.CurrentDBDocument
items = UnwrapElement(IN[0])
incopenings = IN[1]
incshadows = IN[2]
incwalls = IN[3]
incshared = IN[4]
elementlist = list()

for item in items:
	itemlist = list()
	for insert in item.FindInserts(incopenings,incshadows,incwalls,incshared):
		itemlist.append(doc.GetElement(insert))
	elementlist.append(itemlist)
OUT = elementlist
# ----------------------------------------
watch = Watch(python_script)
select_model_elements_2 = DSModelElementsSelection()  # 2 picked in the model
# note: Get Host
python_script_2 = Python(IN[0]=select_model_elements_2)
# ---------- python_script_2.python (12 lines) ----------
import clr
clr.AddReference('RevitAPI')
from Autodesk.Revit.DB import *

faminsts = UnwrapElement(IN[0])
elementlist = list()
for item in faminsts:
	try:
		elementlist.append(item.Host)
	except:
		elementlist.append(list())
OUT = elementlist
# ----------------------------------------
watch_2 = Watch(python_script_2)
firstItem = List.FirstItem(select_model_elements)
python_script_3 = Python(IN[0]=firstItem)
# ---------- python_script_3.python (3 lines) ----------
import clr

OUT = (dir(IN[0]),dir(UnwrapElement(IN[0])))
# ----------------------------------------
watch_3 = Watch(python_script_3)
