# Dynamo graph CreateExampleObject.dyn (Dynamo 0.7.0.21303)

double_slider = DoubleSlider(33.08242872, range=0..100)
double_slider_2 = DoubleSlider(63.80072172, range=0..100)
byTwoDoubles = ZeroTouchEssentials.ZeroTouchEssentials.ByTwoDoubles(double_slider, double_slider_2)
watch = Watch(byTwoDoubles)
B = ZeroTouchEssentials.ZeroTouchEssentials.B(byTwoDoubles)
watch_2 = Watch(B)
A = ZeroTouchEssentials.ZeroTouchEssentials.A(byTwoDoubles)
watch_3 = Watch(A)
returnMultiExample = ZeroTouchEssentials.ZeroTouchEssentials.ReturnMultiExample(B, A)
watch_4 = Watch(returnMultiExample.out1)
watch_5 = Watch(returnMultiExample.out0)
