# Dynamo graph 20140418_buildingSetback_standalone.dyn (Dynamo 1.0.1.1743)

# note: Site Perimeter
code_block = CodeBlock { Point.ByCoordinates(0,0,0); Point.ByCoordinates(50,0,0); Point.ByCoordinates(50,60,0); Point.ByCoordinates(0,50,0); }
code_block_2 = CodeBlock(a=code_block.out0, b=code_block.out1, c=code_block.out2, d=code_block.out3) { {a,b,c,d}; {a,b,d}; }
code_block_3 = CodeBlock { true; }
byPoints = PolyCurve.ByPoints(points=code_block_2.out0, connectLastToFirst=code_block_3)
watch = Watch(byPoints)
code_block_4 = CodeBlock { 0; }
code_block_5 = CodeBlock()
# ---------- code_block_5.designscript (9 lines) ----------
MaxFAR= 15;
DistMajSt=5;
DistMinSt=5;
BonusPubPlaza=10;
skyplaneBase= 75;
skyPlaneAngle= 7.6;
towerPierceSkyplan=0.4;
FloorToFloor=10;
TopOfBuilding=100;
# ----------------------------------------
# note: Setback Height
translate = Geometry.Translate(geometry=watch, xTranslation=code_block_4, yTranslation=code_block_4, zTranslation=code_block_5.skyplaneBase)
# note: Skyplane
code_block_6 = CodeBlock { 0; 7; }
offset = Curve.Offset(curve=translate, distance=code_block_6.out1)
code_block_7 = CodeBlock(x=code_block_6.out1) { x*7.6; }
byCoordinates = Vector.ByCoordinates(x=code_block_6.out0, y=code_block_6.out0, z=code_block_7)
translate_2 = Geometry.Translate(geometry=offset, direction=byCoordinates)
byJoinedCurves = PolyCurve.ByJoinedCurves(translate_2)
create_list = List.Create(byJoinedCurves, translate)
byLoft = Solid.ByLoft(create_list)
intersect = Geometry.Intersect(other=byLoft)
# note: Get Total Floor Area
origin = Point.Origin()
ZAxis = Vector.ZAxis()
byOriginNormal = Plane.ByOriginNormal(origin=origin, normal=ZAxis)
code_block_8 = CodeBlock(F2F=code_block_5.FloorToFloor) { 0..#20..F2F; }
offset_2 = Plane.Offset(byOriginNormal, code_block_8)
intersect_2 = Geometry.Intersect(geometry=byLoft, other=offset_2)
area = Surface.Area(intersect_2)
flatten = Flatten(area)
sum = Math.Sum(flatten)
watch_2 = Watch(sum)
patch = Curve.Patch(watch)
# note: Get Total Site Area
area_2 = Surface.Area(patch)
div = sum / area_2
FAR = Watch(div)
create = List.Create(watch, translate)
byLoft_2 = Solid.ByLoft(create)
