# Dynamo graph ChordMarching_customNode02.dyn (Dynamo 0.7.4.3166)

code_block = CodeBlock { 0; }
code_block_2 = CodeBlock { 2; }
byCoordinates = Point.ByCoordinates()
number = DoubleInput(5)
byCoordinates_2 = Point.ByCoordinates(number, number)
number_2 = DoubleInput(10)
byCoordinates_3 = Point.ByCoordinates(number_2, number_2)
number_3 = DoubleInput(15)
byCoordinates_4 = Point.ByCoordinates(number_3)
create = List.Create(byCoordinates, byCoordinates_2, byCoordinates_3, byCoordinates_4)
byPoints = NurbsCurve.ByPoints(create)
chordsAlongCurve = Custom[ChordsAlongCurve](location=code_block, distance=code_block_2, curve=byPoints)  # Recursively makes equal chord lenght points along a curve
watch = Watch(chordsAlongCurve.location0)
