# Dynamo custom node ChordsAlongCurve.dyf (Dynamo 0.7.4.3141)
# category: buildz
# Recursively makes equal chord lenght points along a curve

curve = Input()
distance = Input()
location = Input()
parameterAtChordLength = Curve.ParameterAtChordLength(curve, distance, location)
pointAtParameter = Curve.PointAtParameter(curve, parameterAtChordLength)
doesIntersect = Geometry.DoesIntersect(curve, pointAtParameter)
parameterAtChordLength_2 = Curve.ParameterAtChordLength(curve, distance, location)
chordsAlongCurve = Custom[ChordsAlongCurve](location=parameterAtChordLength_2, distance=distance, curve=curve)  # Recursively makes equal chord lenght points along a curve
addItemToFront = List.AddItemToFront(chordsAlongCurve.location0, parameterAtChordLength_2)
empty = List.Empty()
scopeIf = ScopedIf(doesIntersect, addItemToFront, empty)
flatten = Flatten(scopeIf)
location_2 = Output(flatten)  # "location"
location_3 = Output(doesIntersect)  # "location"
