# Dynamo graph File.dyn (Dynamo 0.7.2.2114)

file_path = Filename("File_Migration.png")
directory_path = Directory("No file selected.")
code_block = CodeBlock(a=file_path, b=directory_path) { c = FileSystem.LoadImageFromPath(a); FileSystem.WriteImage(b,"Image",c); }
file_path_2 = Filename("File_Migration.xlsx")
code_block_2 = CodeBlock { 10; }
readImage = File.ReadImage(file_path, code_block_2, code_block_2)
exportToCSV = File.ExportToCSV(file_path_2, readImage)
file_path_3 = Filename("File_Migration_Write.txt")
file_path_4 = Filename("File_Migration.txt")
readText = File.ReadText(file_path_4)
writeText = File.WriteText(file_path_3, readText)
