# Dynamo graph Car-Script-bug-stripped-down.dyn (Dynamo 2.9.0.2796)

file_path = Filename(".\CurvesToIntersect.sat")
importFromSAT = Geometry.ImportFromSAT(filePath=file_path)
file_path_2 = Filename(".\SelectionSolid.sat")
importFromSAT_2 = Geometry.ImportFromSAT(filePath=file_path_2)
doesIntersect = Geometry.DoesIntersect(geometry=importFromSAT_2, other=importFromSAT)
filterByBoolMask = List.FilterByBoolMask(list=importFromSAT, mask=doesIntersect)
code_block = CodeBlock { 100; }
translate = Geometry.Translate(geometry=filterByBoolMask.in, xTranslation=code_block)
