# Dynamo graph LargeModel_Intersection_MAGN_9320.dyn (Dynamo 1.0.0.553)

file_path = Filename("..\..\..\test\core\WorkflowTestFiles\GeometryDefects\surface.xlsx")
fromPath = FileObject(file_path)  # "File.FromPath"
code_block = CodeBlock { "SheetX"; }
code_block_2 = CodeBlock { false; }
readFromFile = Excel.ReadFromFile(file=fromPath, sheetName=code_block, readAsStrings=code_block_2)
code_block_3 = CodeBlock { "SheetY"; }
readFromFile_2 = Excel.ReadFromFile(file=fromPath, sheetName=code_block_3, readAsStrings=code_block_2)
code_block_4 = CodeBlock { "SheetZ"; }
readFromFile_3 = Excel.ReadFromFile(file=fromPath, sheetName=code_block_4, readAsStrings=code_block_2)
byCoordinates = Point.ByCoordinates(x=readFromFile, y=readFromFile_2, z=readFromFile_3, lacing=Longest)
code_block_5 = CodeBlock { "weight"; }
readFromFile_4 = Excel.ReadFromFile(file=fromPath, sheetName=code_block_5, readAsStrings=code_block_2)
code_block_6 = CodeBlock { "Uknots"; }
readFromFile_5 = Excel.ReadFromFile(file=fromPath, sheetName=code_block_6, readAsStrings=code_block_2)
code_block_7 = CodeBlock { {0,0,0,0,1,1,1,1}; }
code_block_8 = CodeBlock { 3; }
byControlPointsWeightsKnots = NurbsSurface.ByControlPointsWeightsKnots(byCoordinates, readFromFile_4, readFromFile_5, code_block_7, code_block_8, code_block_8)
number = DoubleInput(0)
integer_slider = IntegerSlider(7, range=0..100 step 1)
integer_slider_2 = IntegerSlider(6, range=0..100 step 1)
code_block_9 = CodeBlock(UNUMBER=integer_slider, VNUMBER=integer_slider_2) { 0.1..0.9..#UNUMBER; 0.1..0.9..#VNUMBER; }
getIsoline = Surface.GetIsoline(byControlPointsWeightsKnots, number, code_block_9.out0, lacing=Longest)
intersect = Geometry.Intersect(geometry=getIsoline, other=byControlPointsWeightsKnots, lacing=Longest)
number_2 = DoubleInput(1)
getIsoline_2 = Surface.GetIsoline(byControlPointsWeightsKnots, number_2, code_block_9.out1, lacing=Longest)
intersect_2 = Geometry.Intersect(geometry=getIsoline_2, other=byControlPointsWeightsKnots, lacing=Longest)
intersectAll = Geometry.IntersectAll(geometry=intersect, others=intersect_2, lacing=CrossProduct)
doesIntersect = Geometry.DoesIntersect(geometry=intersect, other=intersect_2, lacing=CrossProduct)
