# Dynamo graph MAGN_3996_InputAsPolyCurvetoJoinCurves.dyn (Dynamo 0.7.4.3105)

code_block = CodeBlock { Point.Origin(); Point.ByCoordinates(4,5); Point.ByCoordinates(-7,8); }
byStartPointEndPoint = Line.ByStartPointEndPoint(code_block.out0, code_block.out2)
create = List.Create(code_block.out0, code_block.out1, code_block.out2)
code_block_2 = CodeBlock { false; }
byPoints = PolyCurve.ByPoints(create, code_block_2)
create_2 = List.Create(byStartPointEndPoint, byPoints)
byJoinedCurves = PolyCurve.ByJoinedCurves(create_2)
curves = PolyCurve.Curves(byPoints)
addItemToFront = List.AddItemToFront(byStartPointEndPoint, curves)
byJoinedCurves_2 = PolyCurve.ByJoinedCurves(addItemToFront)
