# Dynamo graph MAGN_4578_CCSForTransformedCuboid.dyn (Dynamo 0.7.4.3105)

byLengths = Cuboid.ByLengths()
contextCoordinateSystem = Geometry.ContextCoordinateSystem(byLengths)
code_block = CodeBlock(contextCoordinateSystem) { CS.Origin; }
code_block_2 = CodeBlock { Point.ByCoordinates(5,5,0); Vector.ByCoordinates(1,1,1); Vector.ByCoordinates(0,1,0); }
byOriginVectors = CoordinateSystem.ByOriginVectors(code_block_2.out0, code_block_2.out1, code_block_2.out2)
transform = Geometry.Transform(byLengths, byOriginVectors)
contextCoordinateSystem_2 = Geometry.ContextCoordinateSystem(transform)
code_block_3 = CodeBlock(contextCoordinateSystem_2) { CS1.Origin; }
