# Dynamo graph MAGN_4924_CurveExtractionFromSurface.dyn (Dynamo 0.7.4.3105)

byCoordinates = Point.ByCoordinates()
number = DoubleInput(10)
byCoordinates_2 = Point.ByCoordinates(number)
byStartPointEndPoint = Line.ByStartPointEndPoint(byCoordinates, byCoordinates_2)
number_2 = DoubleInput(5)
byCoordinates_3 = Point.ByCoordinates(arg2=number_2)
byThreePoints = Arc.ByThreePoints(byCoordinates, byCoordinates_3, byCoordinates_2)
create = List.Create(byStartPointEndPoint, byThreePoints)
byJoinedCurves = PolyCurve.ByJoinedCurves(create)
byCoordinates_4 = Point.ByCoordinates(arg1=number)
number_3 = DoubleInput(15)
byCoordinates_5 = Point.ByCoordinates(number_3, number_3)
byStartPointEndPoint_2 = Line.ByStartPointEndPoint(byCoordinates_4, byCoordinates_5)
number_4 = DoubleInput(5)
number_5 = DoubleInput(10)
byCoordinates_6 = Point.ByCoordinates(number_4, number_5, number_5)
byThreePoints_2 = Arc.ByThreePoints(byCoordinates_4, byCoordinates_6, byCoordinates_5)
create_2 = List.Create(byStartPointEndPoint_2, byThreePoints_2)
byJoinedCurves_2 = PolyCurve.ByJoinedCurves(create_2)
create_3 = List.Create(byJoinedCurves, byJoinedCurves_2)
byLoft = Solid.ByLoft(create_3)
volume = Solid.Volume(byLoft)
number_6 = DoubleInput(-2)
number_7 = DoubleInput(5)
byCoordinates_7 = Point.ByCoordinates(number_6, number_7)
create_4 = List.Create(byCoordinates, byCoordinates_7, byCoordinates_4)
byPoints = NurbsCurve.ByPoints(create_4)
# note: Multiple creation methods exist for most Solids.  These examples show Closed Profiles as the base, but polysurfaces can be stitched, many primitives are available (Surfaces, Cuboid, Cone, etc)
byLoft_2 = Solid.ByLoft(create_3, byPoints)
# note: Tip:  Turn off "Preview" in Node Right Click menus to exclude elements from Showing
code_block = CodeBlock { Vector.ByCoordinates(-20,0,0); }
translate = Geometry.Translate(byLoft_2, code_block)
code_block_2 = CodeBlock { 0; }
thinShell = Solid.ThinShell(byLoft, code_block_2)
code_block_3 = CodeBlock { Vector.ByCoordinates(20,0,0); }
translate_2 = Geometry.Translate(thinShell, code_block_3)
code_block_4 = CodeBlock { 5; }
byCoordinates_8 = Point.ByCoordinates(arg2=code_block_4)
ZAxis = Vector.ZAxis()
# note: Geometric Boolean operations (Intersect, Difference, Union, Etc) are available in the Geometry Category.
byOriginNormal = Plane.ByOriginNormal(byCoordinates_8, ZAxis)
code_block_5 = CodeBlock { 10; }
byCoordinates_9 = Point.ByCoordinates(code_block_5, code_block_5, code_block_5)
trim = Geometry.Trim(translate_2, byOriginNormal, byCoordinates_9)
bySolid = PolySurface.BySolid(trim)
surfaces = PolySurface.Surfaces(bySolid)
flatten = Flatten(surfaces)
perimeterCurves = Surface.PerimeterCurves(flatten)
flatten_2 = Flatten(perimeterCurves)
