# Dynamo graph MAGN_5029_CopyPasteWarning.dyn (Dynamo 0.7.4.3105)

code_block = CodeBlock { Point.ByCoordinates(0,0,0); Point.ByCoordinates(5,5,0); Point.ByCoordinates(10,0,0); }
byThreePoints = Arc.ByThreePoints(code_block.out0, code_block.out1, code_block.out2)
code_block_2 = CodeBlock { 0..1..#10; }
pointAtParameter = Curve.PointAtParameter(byThreePoints, code_block_2)
