# Dynamo graph MAGN_5041_NurbsCurveExtend.dyn (Dynamo 0.7.4.3131)

code_block = CodeBlock { Point.ByCoordinates(-5,0); Point.Origin(); Point.ByCoordinates(0,5); }
code_block_2 = CodeBlock(p1=code_block.out0, p2=code_block.out1, p3=code_block.out2) { NurbsCurve.ByPoints({p1,p2,p3}); }
# note: Trouble with distance = 0 for NurbsCurves
double_slider = DoubleSlider(0, range=0..5)
extendStart = Curve.ExtendStart(code_block_2, double_slider)
length = Curve.Length(extendStart)
extendEnd = Curve.ExtendEnd(code_block_2, double_slider)
length_2 = Curve.Length(extendEnd)
# note: Extend nodes
extend = Curve.Extend(code_block_2, double_slider, code_block.out0)
length_3 = Curve.Length(extend)
