# Dynamo graph MAGN_5155_CrashCurveDivideByLengthFromParameter.dyn (Dynamo 4.0.0.2016)

number = DoubleInput(5)
byCoordinates = Point.ByCoordinates(x=number)
byCoordinates_2 = Point.ByCoordinates(y=number)
number_2 = DoubleInput(10)
byCoordinates_3 = Point.ByCoordinates(x=number_2, y=number_2)
byThreePoints = Arc.ByThreePoints(firstPoint=byCoordinates, secondPoint=byCoordinates_2, thirdPoint=byCoordinates_3)
number_3 = DoubleInput(25)
byCoordinates_4 = Point.ByCoordinates(x=number_3)
code_block = CodeBlock { 1; }
tangentAtParameter = Curve.TangentAtParameter(curve=byThreePoints, param=code_block)
byStartPointEndPointStartTangent = Arc.ByStartPointEndPointStartTangent(startPoint=byCoordinates_3, endPoint=byCoordinates_4, startTangent=tangentAtParameter)
create = List.Create(item0=byThreePoints, item1=byStartPointEndPointStartTangent)
byJoinedCurves = PolyCurve.ByJoinedCurves(curves=create)
pointsAtSegmentLengthFromPoint = Curve.PointsAtSegmentLengthFromPoint(curve=byJoinedCurves)
splitByPoints = Curve.SplitByPoints(curve=byJoinedCurves, points=pointsAtSegmentLengthFromPoint)
