# Dynamo graph MAGN_5177_LofByGuideCurvesForSurfaceAndSolid.dyn (Dynamo 0.7.4.3141)

number = DoubleInput(5)
byCoordinates = Point.ByCoordinates()
code_block = CodeBlock { 5; }
byCoordinates_2 = Point.ByCoordinates(code_block, code_block)
number_2 = DoubleInput(10)
byCoordinates_3 = Point.ByCoordinates(number_2, number_2)
number_3 = DoubleInput(15)
byCoordinates_4 = Point.ByCoordinates(number_3)
create = List.Create(byCoordinates, byCoordinates_2, byCoordinates_3, byCoordinates_4)
byPoints = NurbsCurve.ByPoints(create)
startPoint = Curve.StartPoint(byPoints)
code_block_2 = CodeBlock { 0; }
tangentAtParameter = Curve.TangentAtParameter(byPoints, code_block_2)
byOriginNormal = Plane.ByOriginNormal(startPoint, tangentAtParameter)
code_block_3 = CodeBlock { 3; }
byWidthLength = Rectangle.ByWidthLength(byOriginNormal, arg2=code_block_3)
endPoint = Curve.EndPoint(byPoints)
code_block_4 = CodeBlock { 1; }
tangentAtParameter_2 = Curve.TangentAtParameter(byPoints, code_block_4)
byOriginNormal_2 = Plane.ByOriginNormal(endPoint, tangentAtParameter_2)
byWidthLength_2 = Rectangle.ByWidthLength(byOriginNormal_2)
create_2 = List.Create(byWidthLength, byWidthLength_2)
byLoft = Solid.ByLoft(create_2, byPoints)
byLoft_2 = Surface.ByLoft(create_2, byPoints)
byLoft_3 = PolySurface.ByLoft(create_2, byPoints)
