# Dynamo graph MAGN_5365_WrongFunctionPassingToWatchCrashingDynamo.dyn (Dynamo 0.7.4.3151)

code_block = CodeBlock { CoordinateSystem.Identity; Point.Origin; Vector.ZAxis; }
watch = Watch(code_block.out0)
watch_2 = Watch(code_block.out1)
watch_3 = Watch(code_block.out2)
