# Dynamo graph MAGN_5397_ListScanWithPolygon.dyn (Dynamo 0.7.4.3161)

recursivePattern2 = Custom[RecursivePattern2]()  # Takes a PolyCurve and returns a smaller PolyCurve in the pattern
code_block = CodeBlock { {0,20,20,0}; {0,0,20,20}; }
byCoordinates = Point.ByCoordinates(code_block.out0, code_block.out1)
code_block_2 = CodeBlock { true; }
byPoints = PolyCurve.ByPoints(byCoordinates, code_block_2)
code_block_3 = CodeBlock { 1..20; }
scan = ScanList(recursivePattern2, byPoints, code_block_3)  # "List.Scan"
code_block_4 = CodeBlock { Vector.ZAxis(); }
translate = Geometry.Translate(scan, code_block_4, code_block_3)
byLoft = Solid.ByLoft(translate)
