# Dynamo graph MAGN_5407_GroupByKeyWithListOfPoints.dyn (Dynamo 0.7.4.3166)

code_block = CodeBlock { 1..10; }
byCoordinates = Point.ByCoordinates(code_block)
join = List.Join(byCoordinates, byCoordinates)
shuffle = List.Shuffle(join)
X = Point.X()
groupByKey = GroupByKey(shuffle, X)
code_block_2 = CodeBlock(a=groupByKey) { a[0]; }
code_block_3 = CodeBlock(a=groupByKey) { a[5]; }
