# Dynamo graph MAGN_5408_ListUniqueOnGeometryObjects.dyn (Dynamo 0.7.4.3161)

code_block = CodeBlock()
# ---------- code_block.designscript (11 lines) ----------
p1 = Point.ByCoordinates(0,0,0);
p2 = Point.Origin();
p3 = Point.ByCoordinates(1,0,0);

{p1,p2,p3};

l1 = Line.ByStartPointEndPoint(p1, p3);
l2 = l1;
l3 = Line.ByStartPointDirectionLength(p1, Vector.YAxis(), 1);

{l1,l2,l3};
# ----------------------------------------
uniqueItems = List.UniqueItems(code_block.out3)
code_block_2 = CodeBlock(pts=code_block.out3) { pts; }
uniqueItems_2 = List.UniqueItems(code_block.out7)
