# Dynamo graph NurbsSurfaceWeights_MAGN_7970.dyn (Dynamo 0.8.3.2250)

code_block = CodeBlock { Point.ByCoordinates((0..50..#10)<1>, (0..50..#10)<2>, 0); }
code_block_2 = CodeBlock { 0; }
number_slider = DoubleSlider(3.6, range=0..5 step 0.1)
code_block_3 = CodeBlock(scale=number_slider, p=code_block) { scale*Math.Sin((p.Y+p.X)*50); }
translate = Geometry.Translate(geometry=code_block, xTranslation=code_block_2, yTranslation=code_block_2, zTranslation=code_block_3)
code_block_4 = CodeBlock()
# ---------- code_block_4.designscript (10 lines) ----------
{{1,1,1,1,1,1,1,1,1,1},
{1,1,1,1,1,1,1,1,1,1},
{1,1,1,1,1,1,1,1,1,1},
{1,1,1,1,1,1,1,1,1,1},
{1,1,1,1,1,1,1,1,1,1},
{1,1,1,1,1,1,1,1,1,1},
{1,1,1,1,1,1,1,1,1,1},
{1,1,1,1,1,1,1,1,1,1},
{1,1,1,1,1,1,1,1,1,1},
{1,1,1,1,1,1,1,1,1,1}};
# ----------------------------------------
code_block_5 = CodeBlock { {0,0,0,0.1,0.2,0.3,0.4,0.5,0.6,0.7,1,1,1}; }
code_block_6 = CodeBlock { 2; }
byControlPointsWeightsKnots = NurbsSurface.ByControlPointsWeightsKnots(translate, code_block_4, code_block_5, code_block_5, code_block_6, code_block_6)
isRational = NurbsSurface.IsRational(byControlPointsWeightsKnots)
weights = NurbsSurface.Weights(byControlPointsWeightsKnots)
code_block_7 = CodeBlock(a=weights) { a[0]; }
byControlPoints = NurbsSurface.ByControlPoints(controlVertices=translate, uDegree=code_block_6, vDegree=code_block_6)
weights_2 = NurbsSurface.Weights(byControlPoints)
code_block_8 = CodeBlock(a=weights_2) { a[0]; }
