# Dynamo custom node RecursivePattern2.dyf (Dynamo 0.7.4.3161)
# category: Recursive Patterns
# Takes a PolyCurve and returns a smaller PolyCurve in the pattern

polycurve = Input()
curves = PolyCurve.Curves(polycurve)
code_block = CodeBlock { 0.2; }
pointAtParameter = Curve.PointAtParameter(curves, code_block)
code_block_2 = CodeBlock { true; }
byPoints = PolyCurve.ByPoints(pointAtParameter, code_block_2)
curve = Output(byPoints)
dummy = Input()
