# Dynamo graph sweep as solid failure_nurbs.dyn (Dynamo 4.1.0.2940)

file_path = Filename(".\path.sat")
units = Units("Meters")
importFromSATWithUnits = Geometry.ImportFromSATWithUnits(file_filePath=file_path, dynamoUnit=units)
startPoint = Curve.StartPoint(curve=importFromSATWithUnits)
pruneDuplicates = Point.PruneDuplicates(points=startPoint)
endPoint = Curve.EndPoint(curve=importFromSATWithUnits)
pruneDuplicates_2 = Point.PruneDuplicates(points=endPoint)
file_path_2 = Filename(".\profile.sat")
units_2 = Units("Meters")
importFromSATWithUnits_2 = Geometry.ImportFromSATWithUnits(file_filePath=file_path_2, dynamoUnit=units_2)

# group: combine multiple surfaces into one
byUnion = Surface.ByUnion(surfaces=importFromSATWithUnits_2)

# group: get the surface perimeter curves for sweep
perimeterCurves = Surface.PerimeterCurves(surface=byUnion)
byJoinedCurves = PolyCurve.ByJoinedCurves(curves=perimeterCurves)

# group: get the bottom isoline of the surface
getIsoline = Surface.GetIsoline(surface=importFromSATWithUnits_2)

# group: left / middle / right profile point
startPoint_2 = Curve.StartPoint(curve=getIsoline)
code_block = CodeBlock { 0.5; }
pointAtParameter = Curve.PointAtParameter(curve=getIsoline, param=code_block)
endPoint_2 = Curve.EndPoint(curve=getIsoline)

list_create = List.Create(item0=startPoint_2, item1=pointAtParameter, item2=endPoint_2)
align_profile_left_0_center_1 = DoubleSlider(0, range=0..2 step 1)  # "Align Profile: Left (0) / Center (1) / Right (2)"; graph input

# group: get the specified profile alignment point
getItemAtIndex = List.GetItemAtIndex(list=list_create, index=align_profile_left_0_center_1)

UVParameterAtPoint = Surface.UVParameterAtPoint(surface=importFromSATWithUnits_2, point=getItemAtIndex)
U = UV.U(uV=UVParameterAtPoint)
V = UV.V(uV=UVParameterAtPoint)

# group: get the coordinate system at the surface point
coordinateSystemAtParameter = Surface.CoordinateSystemAtParameter(surface=importFromSATWithUnits_2, u=U, v=V)

use_path_start_t_or_end_f = BoolSelector(true)  # graph input

# group: join path curves
byJoinedCurves_2 = PolyCurve.ByJoinedCurves(curves=importFromSATWithUnits)

isClosed = Curve.IsClosed(curve=byJoinedCurves_2)

# group: when curve is closed, remove a tiny segment at the end to ensure sweep works
code_block_2 = CodeBlock { 0.99; }

# group: get the largest curve segment
pointAtParameter_2 = Curve.PointAtParameter(curve=byJoinedCurves_2, param=code_block_2)
splitByPoints = Curve.SplitByPoints(curve=byJoinedCurves_2, points=pointAtParameter_2)
length = Curve.Length(curve=splitByPoints)
maximumItem = List.MaximumItem(list=length)
indexOf = List.IndexOf(list=length, element=maximumItem)
getItemAtIndex_2 = List.GetItemAtIndex(list=splitByPoints, index=indexOf)

list_create_2 = List.Create(item0=startPoint, item1=endPoint)
flatten = List.Flatten(list=list_create_2)
pruneDuplicates_3 = Point.PruneDuplicates(points=flatten)
parameterAtPoint = Curve.ParameterAtPoint(curve=byJoinedCurves_2)  # unwired: point
sortByFunction = List.SortByFunction(list=pruneDuplicates_3, sortFunction=parameterAtPoint)

# group: rebuild the path
byPoints = PolyCurve.ByPoints(points=sortByFunction)

# group: if curve is closed, get a slightly adjusted version
code_block_3 = CodeBlock(x=isClosed, listA=getItemAtIndex_2, listB=byPoints)
# ---------- code_block_3.designscript (11 lines) ----------
x;
listA;
listB;
[Imperative]
{
	if(x==true){
		return = listA;
		}else{
		return = listB;
		}
		};
# ----------------------------------------

# group: path start and end
startPoint_3 = Curve.StartPoint(curve=code_block_3.out3)
endPoint_3 = Curve.EndPoint(curve=code_block_3.out3)

# group: get the specified start or end of the path
code_block_4 = CodeBlock(x=use_path_start_t_or_end_f, listA=startPoint_3, listB=endPoint_3)  # same code as code_block_3

# group: equivalent parameter
parameterAtPoint_2 = Curve.ParameterAtPoint(curve=code_block_3.out3, point=code_block_4.out3)

coordinateSystemAtParameter_2 = Curve.CoordinateSystemAtParameter(curve=code_block_3.out3, param=parameterAtPoint_2)
XAxis = CoordinateSystem.XAxis(coordinateSystem=coordinateSystemAtParameter_2)
reverse = Vector.Reverse(vector=XAxis)
ZAxis = CoordinateSystem.ZAxis(coordinateSystem=coordinateSystemAtParameter_2)
tangentAtParameter = Curve.TangentAtParameter(curve=code_block_3.out3, param=parameterAtPoint_2)

# group: get a coordinate system of the curve at the selected point, and oriented to match the profile surface
byOriginVectors = CoordinateSystem.ByOriginVectors(origin=code_block_4.out3, xAxis=reverse, yAxis=ZAxis, zAxis=tangentAtParameter)

# group: move the sweep profile to the start or end of the path
transform = Geometry.Transform(geometry=byJoinedCurves, targetCoordinateSystem=coordinateSystemAtParameter, sourceCoordinateSystem=byOriginVectors)

code_block_5 = CodeBlock { 1; }
byControlPoints = NurbsCurve.ByControlPoints(points=sortByFunction, degree=code_block_5)

# group: perform the sweep
sweepAsSolid = Curve.SweepAsSolid(curve=transform, path=byControlPoints)

volume = Solid.Volume(solid=sweepAsSolid)
