# Dynamo graph Voronoi.ByParameterOnSurface_MAGN_8039.dyn (Dynamo 0.8.3.2250)

integer_slider = IntegerSlider(100, range=0..1000 step 1)
randomList = Math.RandomList(integer_slider)
randomList_2 = Math.RandomList(integer_slider)
byCoordinates = UV.ByCoordinates(randomList, randomList_2)
code_block = CodeBlock { Point.ByCoordinates(); Point.ByCoordinates(0,0,25); 10; }
byPointsRadius = Cylinder.ByPointsRadius(code_block.out0, code_block.out1, code_block.out2)
explode = Geometry.Explode(byPointsRadius)
code_block_2 = CodeBlock(a=explode) { a[0]; }
byParametersOnSurface = Tessellation.Voronoi.ByParametersOnSurface(byCoordinates, code_block_2)
