# Dynamo graph HNTB_Bridge_Bentdyn.dyn (Dynamo 0.7.2.2114)

# note: Western point
code_block = CodeBlock { 189.22; 96.94; 283.15; }
code_block_2 = CodeBlock(a=code_block.out0, b=code_block.out1, c=code_block.out2) { a-200; b-100; c-200; }
# note: Y-bent top control point WEST
# note: Numbers for 4 north
byCoordinates = Point.ByCoordinates(code_block_2.out0, code_block_2.out1, code_block_2.out2)
# note: Eastern point
code_block_3 = CodeBlock { 251.78; 110.78; 283.15; }
code_block_4 = CodeBlock(a=code_block_3.out0, b=code_block_3.out1, c=code_block_3.out2) { a-200; b-100; c-200; }
# note: Y-bent top control point EAST
byCoordinates_2 = Point.ByCoordinates(code_block_4.out0, code_block_4.out1, code_block_4.out2)
# note: North side of bridge = True
# South side of bridge = False
boolean = BoolSelector(true)
code_block_5 = CodeBlock(wCtrlpt=byCoordinates, eCtrlPt=byCoordinates_2, north=boolean)
# ---------- code_block_5.designscript (8 lines) ----------
// Unit vector pointing west to east in plane of cross section
vec1 = Vector.ByTwoPoints(wCtrlpt, eCtrlPt);
vec2 = Vector.ByCoordinates(vec1.X, vec1.Y, 0);
inPlaneVec = vec2.Normalized();

// Unit vector parallel to ground, OUT from the bridge centerline
vec3 = inPlaneVec.Cross(Vector.ZAxis());
perpVec = (north ? vec3.Reverse() : vec3);
# ----------------------------------------
code_block_6 = CodeBlock { archTopCover = 1.5; archBottomCover = 2.5; pierWidth = 11; R = 20; }
code_block_7 = CodeBlock(archTopCover=code_block_6.archTopCover, archBottomCover=code_block_6.archBottomCover, pierWidth=code_block_6.pierWidth, R=code_block_6.R) { archTopCover; archBottomCover; pierWidth; R; }
code_block_8 = CodeBlock()
# ---------- code_block_8.designscript (15 lines) ----------
R1 = 8;
R2W = 85;
R2E = 55;

BW = 30;
EW = 25;

D1W = 44.57;
D1E = 32.25;

aW = 32;
aE = 38;

BCW = 248.21;
BCE = 249.67;
# ----------------------------------------
code_block_9 = CodeBlock(bcw=code_block_8.BCW, bce=code_block_8.BCE) { bcw-200; bce-200; }
code_block_10 = CodeBlock(R1=code_block_8.R1, R2W=code_block_8.R2W, R2E=code_block_8.R2E, BW=code_block_8.BW, EW=code_block_8.EW, D1W=code_block_8.D1W, D1E=code_block_8.D1E, aW=code_block_8.aW, aE=code_block_8.aE, BCW=code_block_9.out0, BCE=code_block_9.out1) { R1; R2W; R2E; BW; EW; D1W; D1E; aW; aE; BCW; BCE; }
rotate = Vector.Rotate(code_block_5.vec1, code_block_5.perpVec, code_block_10.aW)
code_block_11 = CodeBlock(vec=rotate)
# ---------- code_block_11.designscript (2 lines) ----------
// If Z-coordinate is positive, make negative
Vector.ByCoordinates(vec.X, vec.Y, (vec.Z<0 ? vec.Z : -vec.Z));
# ----------------------------------------
length = Vector.Length(code_block_5.vec1)
byStartPointDirectionLength = Line.ByStartPointDirectionLength(byCoordinates, code_block_11, length)
reverse = Vector.Reverse(code_block_5.vec1)
rotate_2 = Vector.Rotate(reverse, code_block_5.perpVec, code_block_10.aE)
code_block_12 = CodeBlock(vec=rotate_2)  # same code as code_block_11
byStartPointDirectionLength_2 = Line.ByStartPointDirectionLength(byCoordinates_2, code_block_12, length)
intersect = Geometry.Intersect(byStartPointDirectionLength, byStartPointDirectionLength_2)
# note: Y-bent central control point
firstItem = List.FirstItem(intersect)
code_block_13 = CodeBlock(inPlaneVec=code_block_5.inPlaneVec, width=code_block_7.pierWidth, yCtrlPt=firstItem, BCW=code_block_10.BCW, BCE=code_block_10.BCE)
# ---------- code_block_13.designscript (9 lines) ----------
vec1 = inPlaneVec.Scale(width/2);

// Bottom West Arc Point
pt1 = yCtrlPt.Add(vec1.Reverse());
pt2 = Point.ByCoordinates(pt1.X, pt1.Y, BCW);

// Bottom East Arc Point
pt3 = yCtrlPt.Add(vec1);
pt4 = Point.ByCoordinates(pt3.X, pt3.Y, BCE);
# ----------------------------------------
code_block_14 = CodeBlock(westToEastVec=code_block_5.inPlaneVec, R=code_block_7.R) { westToEastVec.Scale(-R); westToEastVec.Scale(R); }
add = Point.Add(code_block_13.pt4, code_block_14.out1)
code_block_15 = CodeBlock(north=boolean, D1W=code_block_10.D1W, D1E=code_block_10.D1E) { north ? -D1W : D1W; north ? D1E : -D1E; }
byCenterPointStartPointSweepAngle = Arc.ByCenterPointStartPointSweepAngle(add, code_block_13.pt4, code_block_15.out1, code_block_5.perpVec)
add_2 = Point.Add(code_block_13.pt2, code_block_14.out0)
byCenterPointStartPointSweepAngle_2 = Arc.ByCenterPointStartPointSweepAngle(add_2, code_block_13.pt2, code_block_15.out0, code_block_5.perpVec)
code_block_16 = CodeBlock(north=boolean, WestArc=byCenterPointStartPointSweepAngle_2, EastArc=byCenterPointStartPointSweepAngle) { north ? WestArc : WestArc.Reverse(); north ? EastArc : EastArc.Reverse(); }
endPoint = Curve.EndPoint(code_block_16.out1)
byTwoPoints = Vector.ByTwoPoints(firstItem, byCoordinates)
# note: Unit vector up WEST arm
normalized = Vector.Normalized(byTwoPoints)
byTwoPoints_2 = Vector.ByTwoPoints(firstItem, byCoordinates_2)
# note: Unit vector up EAST arm
normalized_2 = Vector.Normalized(byTwoPoints_2)
code_block_17 = CodeBlock(westArmVec=normalized, perpVec=code_block_5.perpVec, eastArmVec=normalized_2, north=boolean, topCover=code_block_7.archTopCover, wCtrlPt=byCoordinates, botCover=code_block_7.archBottomCover, eCtrlPt=byCoordinates_2)
# ---------- code_block_17.designscript (19 lines) ----------
// Unit vectors perp. to arms: up if north, down if south
westArmPerpVec = westArmVec.Cross(perpVec.Reverse());
eastArmPerpVec = eastArmVec.Cross(perpVec);

// West arm top vector and point
wTop = westArmPerpVec.Scale(north ? topCover : -topCover);
wCtrlPt.Add(wTop);

// West arm bottom vector and point
wBot = westArmPerpVec.Scale(north ? -botCover : botCover);
wCtrlPt.Add(wBot);

// East arm top vector and point
eTop = eastArmPerpVec.Scale(north ? topCover : -topCover);
eCtrlPt.Add(eTop);

// East arm bottom vector and point
eBot = eastArmPerpVec.Scale(north ? -botCover : botCover);
eCtrlPt.Add(eBot);
# ----------------------------------------
scale = Vector.Scale(normalized, code_block_10.BW)
add_3 = Point.Add(firstItem, scale)
add_4 = Point.Add(add_3, code_block_17.wBot)
scale_2 = Vector.Scale(normalized_2, code_block_10.EW)
add_5 = Point.Add(firstItem, scale_2)
add_6 = Point.Add(add_5, code_block_17.eBot)
code_block_18 = CodeBlock(westArmPerpVec=code_block_17.westArmPerpVec, north=boolean, R2W=code_block_10.R2W, wArcTopPt=add_4, eastArmPerpVec=code_block_17.eastArmPerpVec, R2E=code_block_10.R2E, eArcTopPt=add_6)
# ---------- code_block_18.designscript (7 lines) ----------
// West arm underside arc top center point
wArc = westArmPerpVec.Scale(north ? -R2W : R2W);
wArcTopPt.Add(wArc);

// East arm underside arc top center point
eArc = eastArmPerpVec.Scale(north ? -R2E : R2E);
eArcTopPt.Add(eArc);
# ----------------------------------------
code_block_19 = CodeBlock(north=boolean) { north ? 90 : -90; north ? -90 : 90; }
byCenterPointStartPointSweepAngle_3 = Arc.ByCenterPointStartPointSweepAngle(code_block_18.out3, add_6, code_block_19.out1, code_block_5.perpVec)
closestPointTo = Geometry.ClosestPointTo(byCenterPointStartPointSweepAngle_3, endPoint)
parameterAtPoint = Curve.ParameterAtPoint(byCenterPointStartPointSweepAngle_3, closestPointTo)
code_block_20 = CodeBlock(north=boolean, param=parameterAtPoint) { north ? (1+param)/2 : param/2; }
pointAtParameter = Curve.PointAtParameter(byCenterPointStartPointSweepAngle_3, code_block_20)
byThreePoints = Arc.ByThreePoints(endPoint, pointAtParameter, add_6)
byStartPointEndPoint = Line.ByStartPointEndPoint(add_6, code_block_17.out9)
byStartPointEndPoint_2 = Line.ByStartPointEndPoint(code_block_17.out7, code_block_17.out9)
byStartPointEndPoint_3 = Line.ByStartPointEndPoint(firstItem, byCoordinates_2)
translate = Geometry.Translate(byStartPointEndPoint_3, code_block_17.eTop)
byStartPointEndPoint_4 = Line.ByStartPointEndPoint(firstItem, byCoordinates)
translate_2 = Geometry.Translate(byStartPointEndPoint_4, code_block_17.wTop)
byFillet = Arc.ByFillet(translate, translate_2, code_block_10.R1)
endPoint_2 = Curve.EndPoint(byFillet)
byStartPointEndPoint_5 = Line.ByStartPointEndPoint(code_block_17.out7, endPoint_2)
startPoint = Curve.StartPoint(byFillet)
byStartPointEndPoint_6 = Line.ByStartPointEndPoint(startPoint, code_block_17.out3)
byStartPointEndPoint_7 = Line.ByStartPointEndPoint(code_block_17.out5, code_block_17.out3)
byStartPointEndPoint_8 = Line.ByStartPointEndPoint(code_block_17.out5, add_4)
byCenterPointStartPointSweepAngle_4 = Arc.ByCenterPointStartPointSweepAngle(code_block_18.out1, add_4, code_block_19.out0, code_block_5.perpVec)
startPoint_2 = Curve.StartPoint(code_block_16.out0)
closestPointTo_2 = Geometry.ClosestPointTo(byCenterPointStartPointSweepAngle_4, startPoint_2)
parameterAtPoint_2 = Curve.ParameterAtPoint(byCenterPointStartPointSweepAngle_4, closestPointTo_2)
code_block_21 = CodeBlock(north=boolean, param=parameterAtPoint_2) { north ? param/2 : (1+param)/2; }
pointAtParameter_2 = Curve.PointAtParameter(byCenterPointStartPointSweepAngle_4, code_block_21)
byThreePoints_2 = Arc.ByThreePoints(add_4, pointAtParameter_2, startPoint_2)
code_block_22 = CodeBlock(BCW=code_block_10.BCW, BCE=code_block_10.BCE, p1=code_block_13.pt2, p2=code_block_13.pt4)
# ---------- code_block_22.designscript (3 lines) ----------
lowest = (BCW<BCE ? BCW : BCE);
west = Point.ByCoordinates(p1.X, p1.Y, lowest);
east = Point.ByCoordinates(p2.X, p2.Y, lowest);
# ----------------------------------------
byStartPointEndPoint_9 = Line.ByStartPointEndPoint(code_block_22.west, code_block_22.east)
code_block_23 = CodeBlock(BCW=code_block_10.BCW, BCE=code_block_10.BCE) { BCW < BCE; }
byStartPointEndPoint_10 = Line.ByStartPointEndPoint(code_block_22.east, code_block_13.pt4)
code_block_24 = CodeBlock { null; }
if_ = If(code_block_23, byStartPointEndPoint_10, code_block_24)
# note: DON'T WORRY!!  One or two of these nodes are supposed to be throwing a warning.
# Make a short vertical line for each side in the case that the bottom of the arcs don't align.  At least one of these will be null, and possibly both.  Null values will be stripped out before being passed on to make the closed Polycurve.
code_block_25 = CodeBlock(BCW=code_block_10.BCW, BCE=code_block_10.BCE) { BCW > BCE; }
byStartPointEndPoint_11 = Line.ByStartPointEndPoint(code_block_13.pt2, code_block_22.west)
code_block_26 = CodeBlock { null; }
if_2 = If(code_block_25, byStartPointEndPoint_11, code_block_26)
create = List.Create(byStartPointEndPoint_9, if_, if_2)
# note: Filter out the null value
isNull = Object.IsNull(create)
filterByBoolMask = List.FilterByBoolMask(create, isNull)
create_2 = List.Create(byCenterPointStartPointSweepAngle, byThreePoints, byStartPointEndPoint, byStartPointEndPoint_2, byStartPointEndPoint_5, byFillet, byStartPointEndPoint_6, byStartPointEndPoint_7, byStartPointEndPoint_8, byThreePoints_2, byCenterPointStartPointSweepAngle_2, filterByBoolMask.out1)
flatten = Flatten(create_2)
# note: Planar closed PolyCurve outline
byJoinedCurves = PolyCurve.ByJoinedCurves(flatten)
code_block_27 = CodeBlock { pierDepth = 7; cantAngle = 9; R4west = 20.3; R4east = 20.27; D2W = 57.68; D2E = 51.66; insideMiddleWidth = 4; }
code_block_28 = CodeBlock(pierDepth=code_block_27.pierDepth, cantAngle=code_block_27.cantAngle, R4west=code_block_27.R4west, R4east=code_block_27.R4east, D2W=code_block_27.D2W, D2E=code_block_27.D2E, insideMiddleWidth=code_block_27.insideMiddleWidth) { pierDepth; cantAngle; R4west; R4east; D2W; D2E; insideMiddleWidth; }
code_block_29 = CodeBlock(north=boolean, perpVec=code_block_5.perpVec, inPlaneVec=code_block_5.inPlaneVec, wCtrlPt=byCoordinates, cantAngle=code_block_28.cantAngle, insideMiddleWidth=code_block_28.insideMiddleWidth, pierWidth=code_block_28.pierDepth, pierDepth=code_block_28.pierDepth, D2W=code_block_28.D2W, D2E=code_block_28.D2E, R4W=code_block_28.R4west, R4E=code_block_28.R4east, BCW=code_block_10.BCW, BCE=code_block_10.BCE)
# ---------- code_block_29.designscript (23 lines) ----------
// Unit vecs and orientation
north;
perpVec;
inPlaneVec;

// Measurements
topLevel = wCtrlPt.Z;
cantAngle;
insideMiddleWidth;

// East-West structural dimension
pierWidth;

// North-South structural dimension
pierDepth;

// Inside arcs
D2W;
D2E;
R4W;
R4E;
BCW;
BCE;
# ----------------------------------------
code_block_30 = CodeBlock(perpVec=code_block_29.perpVec, structBentWidth=code_block_28.pierDepth, wCtrlPt=byCoordinates, eCtrlPt=byCoordinates_2)
# ---------- code_block_30.designscript (14 lines) ----------
inVec = perpVec.Scale(-structBentWidth/2);
outVec = perpVec.Scale(structBentWidth/2);

// WEST Top Control Point projected INSIDE
wCtrlPt.Add(inVec);

// WEST Top Control Point projected OUTSIDE
wCtrlPt.Add(outVec);

// EAST Top Control Point projected INSIDE
eCtrlPt.Add(inVec);

// EAST Top Control Point projected OUTSIDE
eCtrlPt.Add(outVec);
# ----------------------------------------
translate_3 = Geometry.Translate(byJoinedCurves, code_block_30.outVec)
code_block_31 = CodeBlock(topLine=code_block_29.topLevel, bottomCtrlPt=code_block_22.lowest, deg=code_block_28.cantAngle) { height = topLine - bottomCtrlPt; x = height * Math.Tan(deg); }
code_block_32 = CodeBlock(structBentWidth=code_block_29.pierWidth, x=code_block_31.x) { structBentWidth + x; -(structBentWidth/2+ x); }
extrude = Curve.Extrude(translate_3, code_block_32.out0)
code_block_33 = CodeBlock(north=code_block_29.north, angle=code_block_28.cantAngle) { north ? -angle : angle; }
rotate_3 = Vector.Rotate(code_block_29.perpVec, code_block_29.inPlaneVec, code_block_33)
byOriginNormal = Plane.ByOriginNormal(code_block_30.out2, rotate_3)
intersect_2 = Geometry.Intersect(extrude, byOriginNormal)
byJoinedCurves_2 = PolyCurve.ByJoinedCurves(intersect_2)
create_3 = List.Create(translate_3, byJoinedCurves_2)
byLoft = Solid.ByLoft(create_3)
scale_3 = Vector.Scale(code_block_29.perpVec, code_block_32.out1)
code_block_34 = CodeBlock(R4west=code_block_28.R4west, R=code_block_7.R, R4east=code_block_28.R4east) { R4west - R; -R4east + R; }
scale_4 = Vector.Scale(code_block_29.inPlaneVec, code_block_34.out0)
add_7 = Vector.Add(scale_3, scale_4)
add_8 = Point.Add(add_2, add_7)
code_block_35 = CodeBlock(R4west=code_block_28.R4west, R4east=code_block_28.R4east) { R4west; -R4east; }
scale_5 = Vector.Scale(code_block_29.inPlaneVec, code_block_35.R4west)
add_9 = Point.Add(add_8, scale_5)
code_block_36 = CodeBlock(D2W=code_block_28.D2W) { -D2W; }
byCenterPointStartPointSweepAngle_5 = Arc.ByCenterPointStartPointSweepAngle(add_8, add_9, code_block_36, rotate_3)
scale_6 = Vector.Scale(code_block_29.inPlaneVec, code_block_34.out1)
add_10 = Vector.Add(scale_3, scale_6)
add_11 = Point.Add(add, add_10)
scale_7 = Vector.Scale(code_block_29.inPlaneVec, code_block_35.out1)
add_12 = Point.Add(add_11, scale_7)
byCenterPointStartPointSweepAngle_6 = Arc.ByCenterPointStartPointSweepAngle(add_11, add_12, code_block_28.D2E, rotate_3)
code_block_37 = CodeBlock(vec1=normalized, vec2=code_block_5.perpVec) { vec1.Cross(vec2); }
code_block_38 = CodeBlock(D2W=code_block_28.D2W) { -D2W; }
byCenterPointStartPointSweepAngle_7 = Arc.ByCenterPointStartPointSweepAngle(arg2=code_block_38, arg3=rotate_3)
byCenterPointStartPointSweepAngle_8 = Arc.ByCenterPointStartPointSweepAngle(arg2=code_block_28.D2E, arg3=rotate_3)
code_block_39 = CodeBlock(bottomLine=byStartPointEndPoint_9, topLevel=code_block_29.topLevel, pierDepth=code_block_29.pierDepth, cantAngle=code_block_29.cantAngle, perpVec=code_block_29.perpVec, outVec=code_block_30.outVec)
# ---------- code_block_39.designscript (10 lines) ----------
// Midpoint at bottom
midPt = bottomLine.PointAtParameter(0.5);

// Midpoint at bottom projected INSIDE
vertDist = topLevel - midPt.Z;
horizDist = pierDepth/2 + (vertDist * Math.Tan(cantAngle));
midPt.Add(perpVec.Scale(-horizDist));

// Midpoint at bottom projected OUTSIDE;
midPt.Add(outVec);
# ----------------------------------------
code_block_40 = CodeBlock(inMidPt=code_block_39.out3, inPlaneVec=code_block_29.inPlaneVec, inMiddleWidth=code_block_29.insideMiddleWidth)
# ---------- code_block_40.designscript (5 lines) ----------
// West base pt
inMidPt.Add(inPlaneVec.Scale(-inMiddleWidth/2));

// East base pt
inMidPt.Add(inPlaneVec.Scale(inMiddleWidth/2));
# ----------------------------------------
code_block_41 = CodeBlock(westBasePt=code_block_40.out0, eastBasePt=code_block_40.out1, D2W=code_block_29.D2W, D2E=code_block_29.D2E, R4W=code_block_29.R4W, R4E=code_block_29.R4E, BCW=code_block_29.BCW, BCE=code_block_29.BCE, inPlaneVec=code_block_29.inPlaneVec, tiltedNormal=rotate_3, cantAngle=code_block_29.cantAngle, north=code_block_29.north) { westBasePt; eastBasePt; D2W; D2E; R4W; R4E; BCW; BCE; inPlaneVec; tiltedNormal; cantAngle; north; }
python_script = Python(IN[0]=code_block_41.westBasePt, IN[1]=code_block_41.eastBasePt, IN[2]=code_block_41.D2W, IN[3]=code_block_41.D2E, IN[4]=code_block_41.R4W, IN[5]=code_block_41.R4E, IN[6]=code_block_41.BCW, IN[7]=code_block_41.BCE, IN[8]=code_block_41.inPlaneVec, IN[9]=code_block_41.tiltedNormal, IN[10]=code_block_41.cantAngle, IN[11]=code_block_41.north)
# ---------- python_script.python (33 lines) ----------
import clr
clr.AddReference('ProtoGeometry')
from Autodesk.DesignScript.Geometry import *

# Get inputs
westBasePt = IN[0]
eastBasePt = IN[1]
D2W = IN[2]
D2E = IN[3]
R4W = IN[4]
R4E = IN[5]
BCW = IN[6]
BCE = IN[7]
inPlaneVec = IN[8]
tiltedNormal = IN[9]
cantAngle = IN[10]
north = IN[11]

# Get vector up the tilted plane
vecUpTiltedPlane = inPlaneVec.Cross(tiltedNormal)
if north != True:
	vecUpTiltedPlane = vecUpTiltedPlane.Reverse()

# Get arc base points






# Output
OUT = []
OUT.append(vecUpTiltedPlane)
# ----------------------------------------
watch = Watch(python_script)
code_block_42 = CodeBlock(x=code_block_29.pierWidth) { x; }
code_block_43 = CodeBlock(x=code_block_39.out3) { x; }
