# Dynamo graph Combine.dyn (Dynamo 0.7.5.3327)

# note: The Surface.ByLoft expects a list of curves. So we use the List.Create method as the combinator on the List.Combine node, specifying two input ports. This will take our collection of curves on the surface and our collection of offset curves and "zip" them into sublists, each with two curves.
create = List.Create()
code_block = CodeBlock { x = 0..360..24; }
code_block_2 = CodeBlock { 0.2; }
mul = code_block * code_block_2
code_block_3 = CodeBlock { 0; }
sin = Math.Sin(code_block)
code_block_4 = CodeBlock { 4; }
mul_2 = sin * code_block_4
byCoordinates = Point.ByCoordinates(mul, code_block_3, mul_2)
byPoints = NurbsCurve.ByPoints(byCoordinates)
code_block_5 = CodeBlock { 20; }
code_block_6 = CodeBlock { 120; }
add = code_block + code_block_6
sin_2 = Math.Sin(add)
code_block_7 = CodeBlock { 4; }
mul_3 = sin_2 * code_block_7
byCoordinates_2 = Point.ByCoordinates(mul, code_block_5, mul_3)
byPoints_2 = NurbsCurve.ByPoints(byCoordinates_2)
code_block_8 = CodeBlock { 50; 0; }
translate = Geometry.Translate(byPoints, code_block_8.out1, code_block_8.out0, code_block_8.out1)
code_block_9 = CodeBlock(a=byPoints, b=byPoints_2, c=translate) { crves = {a, b, c}; }
byLoft = Surface.ByLoft(code_block_9)
integer_slider = IntegerSlider(15, range=0..100)
code_block_10 = CodeBlock(end=integer_slider) { 0..1..#end; }
pointAtParameter = Surface.PointAtParameter(byLoft, code_block_10, code_block_10, lacing=CrossProduct)
transpose = List.Transpose(pointAtParameter)
byPoints_3 = NurbsCurve.ByPoints()
map = List.Map(transpose, byPoints_3)
firstItem = List.FirstItem()
# note: Let's find the Y coordinate of the first point in each of the lists.
map_2 = List.Map(transpose, firstItem)
Y = Point.Y(map_2)
code_block_11 = CodeBlock { 0.1; }
mul_4 = Y * code_block_11
# note: Create some offset curves where the offset is a function of the Y coordinate we found in the previous step.
offset = Curve.Offset(map, mul_4)
combine = List.Combine(create, map, offset)
byLoft_2 = Surface.ByLoft(combine)
