# Dynamo graph Count.dyn (Dynamo 0.7.5.3327)

add = _ + _
# note: Count is useful when you want to use the length of a list as an input to another node. In this example, we use the Count of the series 0..42 as the amount input to the List.OfRepeatedItem. By using count in this way, we ensure that the list of repeated items will always have the same number of elements as the original series.
code_block = CodeBlock { "foo"; }
number = DoubleInput(0..42)
count = Count(number)
ofRepeatedItem = List.OfRepeatedItem(code_block, count)
combine = List.Combine(add, ofRepeatedItem, number)
