# Dynamo graph CreateList.dyn (Dynamo 0.7.5.3327)

number = DoubleInput(42)
string = StringInput("The answer to everything")
code_block = CodeBlock { {"foo","bar"}; }
# note: List.Create enables the creation of a list of disparate elements. These elements can be single elements or lists of elements.
create = List.Create(number, string, code_block)
watch = Watch(create)
