# Dynamo graph Flatten.dyn (Dynamo 0.7.5.3327)

number = DoubleInput(0..5)
create = List.Create(number, number, number)
watch = Watch(create)
# note: Flattening a multi-dimensional list creates a one-dimensional list containing all the elements of all the lists.
flatten = Flatten(watch)
watch_2 = Watch(flatten)
create_2 = List.Create(create, create, create)
watch_3 = Watch(create_2)
number_2 = DoubleInput(1)
# note: You can also use List.Flatten which allows you to specify the amount you want to flatten. With this node, flattening happens from the outside in. For example, if you specify 1 for the amount, the outer-most level of the hierarchy will be flattened.
flatten_2 = List.Flatten(watch_3, number_2)
watch_4 = Watch(flatten_2)
