# Dynamo graph Lacing.dyn (Dynamo 0.7.5.3327)

number = DoubleInput(0..3)
number_2 = DoubleInput(2)
byCoordinates = Point.ByCoordinates(number, number_2)
number_3 = DoubleInput(0..10)
byCoordinates_2 = Point.ByCoordinates(number_3)
# note: Lacing allows you to specify how the inputs to a node will be handled. Right click on the Line.ByStartPointEndPoint node and change the lacing. Notice what happens to the number of lines.
byStartPointEndPoint = Line.ByStartPointEndPoint(byCoordinates, byCoordinates_2)
