# Dynamo graph Map.dyn (Dynamo 0.7.5.3327)

code_block = CodeBlock { x = 0..360..24; }
code_block_2 = CodeBlock { 0.2; }
mul = code_block * code_block_2
code_block_3 = CodeBlock { 0; }
sin = Math.Sin(code_block)
code_block_4 = CodeBlock { 4; }
mul_2 = sin * code_block_4
byCoordinates = Point.ByCoordinates(mul, code_block_3, mul_2)
byPoints = NurbsCurve.ByPoints(byCoordinates)
code_block_5 = CodeBlock { 20; }
code_block_6 = CodeBlock { 120; }
add = code_block + code_block_6
sin_2 = Math.Sin(add)
code_block_7 = CodeBlock { 4; }
mul_3 = sin_2 * code_block_7
byCoordinates_2 = Point.ByCoordinates(mul, code_block_5, mul_3)
byPoints_2 = NurbsCurve.ByPoints(byCoordinates_2)
code_block_8 = CodeBlock { 50; 0; }
translate = Geometry.Translate(byPoints, code_block_8.out1, code_block_8.out0, code_block_8.out1)
code_block_9 = CodeBlock(a=byPoints, b=byPoints_2, c=translate) { crves = {a, b, c}; }
byLoft = Surface.ByLoft(code_block_9)
integer_slider = IntegerSlider(36, range=0..100)
code_block_10 = CodeBlock(end=integer_slider) { 0..1..#end; }
pointAtParameter = Surface.PointAtParameter(byLoft, code_block_10, code_block_10, lacing=CrossProduct)
byPoints_3 = NurbsCurve.ByPoints()
map = List.Map(pointAtParameter, byPoints_3)
