# Dynamo graph MinMax.dyn (Dynamo 0.7.5.3327)

number = DoubleInput(0..42)
minimumItem = List.MinimumItem(number)
maximumItem = List.MaximumItem(number)
create = List.Create(minimumItem, maximumItem)
watch = Watch(create)
# note: MinimumItem and MaximumItem are useful when you want to find the maximum or minimum values in a list based on their natural sort order. For numbers, the sort order is their numeric value. For strings, the sort order is alphabetical.
code_block = CodeBlock { {"Tywin","Cersei","Hodor","Tyrian"}; }
minimumItem_2 = List.MinimumItem(code_block)
maximumItem_2 = List.MaximumItem(code_block)
create_2 = List.Create(minimumItem_2, maximumItem_2)
watch_2 = Watch(create_2)
