# Dynamo graph Reverse.dyn (Dynamo 0.7.5.3327)

code_block = CodeBlock { 0..5; 6..10; 11..15; }
# note: Reversing a one-dimensional list does exactly what you'd expect. It puts the objects in reverse order.
reverse = List.Reverse(code_block.out0)
watch = Watch(reverse)
create = List.Create(code_block.out0, code_block.out1, code_block.out2)
# note: Reversing a two-dimensional list reverses the order of the internal lists.
reverse_2 = List.Reverse(create)
watch_2 = Watch(reverse_2)
reverse_3 = List.Reverse()
# note: Mapping the Reverse operation over a two-dimensional list, conducts a reverse operation on each of the internal lists.
map = List.Map(create, reverse_3)
watch_3 = Watch(map)
