# Dynamo graph Sort.dyn (Dynamo 0.7.5.3327)

code_block = CodeBlock { {"dog","cat","cheese",-2,42.0}; }
# note: Sort uses the natural sort order of the items in the list to reorder the list.
sort = List.Sort(code_block)
watch = Watch(sort)
