# Dynamo graph SortGeometry.dyn (Dynamo 0.7.5.3213)

code_block = CodeBlock { 0..15; }
count = Count(code_block)
randomList = Math.RandomList(count)
mul = randomList * count
shuffle = List.Shuffle(code_block)
# note: Randomized list of points
byCoordinates = Point.ByCoordinates(mul, shuffle)
Y = Point.Y()
# note: Connect PolyCurve.ByPoints to the list of points sorted by Y-value
sortByKey = SortByKey(byCoordinates, Y)
byPoints = PolyCurve.ByPoints(byCoordinates)
