# Dynamo graph Transpose.dyn (Dynamo 0.8.1.1321)

# note: Transpose switches the "rows" and "columns" of a two dimensional list.
number = DoubleInput(0..9)
byCoordinates = Point.ByCoordinates(x=number, y=number, lacing=CrossProduct)
byPoints = NurbsCurve.ByPoints(byCoordinates)
transpose = List.Transpose(byCoordinates)
