# Dynamo graph SmileyFace.dyn (Dynamo 4.0.0.2016)

code_block = CodeBlock()
# ---------- code_block.designscript (5 lines) ----------
def Remap(value,oldMin,oldMax,newMin,newMax)
{
a = (value - oldMin) / (oldMax - oldMin);
return = a * (newMax - newMin) + newMin;
};
# ----------------------------------------
code_block_2 = CodeBlock { Point.ByCoordinates(40,0,40); Point.ByCoordinates(-40,0,40); 50; }
byCenterPointRadius = Sphere.ByCenterPointRadius(centerPoint=code_block_2.out0, radius=code_block_2.out2)
byCenterPointRadius_2 = Sphere.ByCenterPointRadius(centerPoint=code_block_2.out1, radius=code_block_2.out2)
difference = Solid.Difference(solid=byCenterPointRadius, other=byCenterPointRadius_2)
explode = Geometry.Explode(geometry=difference)
difference_2 = Solid.Difference(solid=byCenterPointRadius_2, other=byCenterPointRadius)
explode_2 = Geometry.Explode(geometry=difference_2)
code_block_3 = CodeBlock(x=explode, y=explode_2) { [x[0],y[0]]; }
byJoinedSurfaces = Solid.ByJoinedSurfaces(facesOfSolid=code_block_3)
code_block_4 = CodeBlock { Point.ByCoordinates(10,11,48); Point.ByCoordinates(10,-11,48); 6; }
code_block_5 = CodeBlock(pt1=code_block_4.out0, pt2=code_block_4.out1) { vec = Vector.ByCoordinates(-20,0,0); pt1.Add(vec); pt2.Add(vec); }
byPointsRadius = Cylinder.ByPointsRadius(startPoint=code_block_4.out0, endPoint=code_block_5.out1, radius=code_block_4.out2)
byPointsRadius_2 = Cylinder.ByPointsRadius(startPoint=code_block_4.out1, endPoint=code_block_5.out2, radius=code_block_4.out2)
happy_sad = DoubleSlider(1, range=-1..1 step 0.1)
code_block_6 = CodeBlock(x=happy_sad)
# ---------- code_block_6.designscript (18 lines) ----------
// top point
top = Point.ByCoordinates(10,0,30);

// bottom point
botFactor = Remap(x,-1,1,3,0);
bot = Point.ByCoordinates(10,0,22+botFactor);

// Circle for mouth corners to travel along
center = Point.ByCoordinates(10,0,40);
cir = Circle.ByCenterPointRadiusNormal(center,21,Vector.XAxis());

// left point
leftParam = Remap(x,-1,1,0.82,0.95);
left = cir.PointAtParameter(leftParam);

// right point
rightParam = Remap(x,-1,1,0.68,0.55);
right = cir.PointAtParameter(rightParam);
# ----------------------------------------
create = List.Create(item0=code_block_6.left, item1=code_block_6.bot, item2=code_block_6.right)
byPoints = NurbsCurve.ByPoints(points=create)
create_2 = List.Create(item0=code_block_6.left, item1=code_block_6.top, item2=code_block_6.right)
byPoints_2 = NurbsCurve.ByPoints(points=create_2)
create_3 = List.Create(item0=byPoints, item1=byPoints_2)
byJoinedCurves = PolyCurve.ByJoinedCurves(curves=create_3)
extrudeAsSolid = Curve.ExtrudeAsSolid(curve=byJoinedCurves, direction=code_block_5.vec)
create_4 = List.Create(item0=byPointsRadius, item1=byPointsRadius_2, item2=extrudeAsSolid)
code_block_7 = CodeBlock(a=byJoinedSurfaces, b=create_4) { [a,b]; }
flatten = List.Flatten(list=code_block_7)
byUnion = Solid.ByUnion(solids=flatten)
