# Dynamo graph Woven Surface.dyn (Dynamo 0.7.6.4256)

code_block = CodeBlock()
# ---------- code_block.designscript (6 lines) ----------
def IntervalMidPts(num)
{
a = 0..1..#(num+1);
b = List.RestOfItems(a);
return = b - (1/(2*num));
};
# ----------------------------------------
code_block_2 = CodeBlock()
# ---------- code_block_2.designscript (14 lines) ----------
// Create a surface

pts1 = {Point.ByCoordinates(-15,-5),
Point.Origin(),
Point.ByCoordinates(15,5)};

pts2 = {Point.ByCoordinates(-15,-5,10),
Point.ByCoordinates(0,0,10),
Point.ByCoordinates(15,-5,15)};

crv1 = NurbsCurve.ByPoints(pts1);
crv2 = NurbsCurve.ByPoints(pts2);

Surface.ByLoft({crv1,crv2});
# ----------------------------------------
code_block_3 = CodeBlock { {0,1}; }
number_of_staves = IntegerSlider(5, range=0..15 step 1)
number_of_weaves = IntegerSlider(4, range=0..15 step 1)
code_block_4 = CodeBlock(numStaves=number_of_staves, numWeaves=number_of_weaves) { IntervalMidPts(numStaves); IntervalMidPts(numWeaves); }
pointAtParameter = Surface.PointAtParameter(code_block_2.out4, code_block_3, code_block_4.out1, lacing=CrossProduct)
tangentAtVParameter = Surface.TangentAtVParameter(code_block_2.out4, code_block_3, code_block_4.out1, lacing=CrossProduct)
weave_width = DoubleSlider(2.352, range=0..5 step 0.01)
code_block_5 = CodeBlock(weaveWidth=weave_width) { weaveWidth/2; -weaveWidth/2; }
scale = Vector.Scale(tangentAtVParameter, code_block_5.out0)
add = Point.Add(pointAtParameter, scale)
scale_2 = Vector.Scale(tangentAtVParameter, code_block_5.out1)
add_2 = Point.Add(pointAtParameter, scale_2)
byStartPointEndPoint = Line.ByStartPointEndPoint(add, add_2)
code_block_6 = CodeBlock(lines=byStartPointEndPoint) { {lines[0]}; {lines[1]}; }
pointAtParameter_2 = Surface.PointAtParameter(code_block_2.out4, code_block_4.out0, code_block_4.out1, lacing=CrossProduct)
tangentAtVParameter_2 = Surface.TangentAtVParameter(code_block_2.out4, code_block_4.out0, code_block_4.out1, lacing=CrossProduct)
code_block_7 = CodeBlock(weaveWidth=weave_width) { weaveWidth/2; -weaveWidth/2; }
scale_3 = Vector.Scale(tangentAtVParameter_2, code_block_7.out0)
add_3 = Point.Add(pointAtParameter_2, scale_3)
scale_4 = Vector.Scale(tangentAtVParameter_2, code_block_7.out1)
add_4 = Point.Add(pointAtParameter_2, scale_4)
byStartPointEndPoint_2 = Line.ByStartPointEndPoint(add_3, add_4)
normalAtParameter = Surface.NormalAtParameter(code_block_2.out4, code_block_4.out0, code_block_4.out1, lacing=CrossProduct)
depth = DoubleSlider(1.352, range=0..5 step 0.01)
code_block_8 = CodeBlock(norm=normalAtParameter, depth=depth) { norm.Scale(depth/2); norm.Scale(-depth/2); }
translate = Geometry.Translate(byStartPointEndPoint_2, code_block_8.out0)
translate_2 = Geometry.Translate(byStartPointEndPoint_2, code_block_8.out1)
python_script = Python(IN[0]=translate, IN[1]=translate_2)
# ---------- python_script.python (17 lines) ----------
import clr
clr.AddReference('ProtoGeometry')
from Autodesk.DesignScript.Geometry import *

# inputs
ls1 = IN[0]
ls2 = IN[1]

set = []

for i in range(0, len(ls1), 2):
	set.append(ls1[i])
	if i < (len(ls2) - 1):
		set.append(ls2[i+1])

#Assign your output to the OUT variable
OUT = set
# ----------------------------------------
join = List.Join(code_block_6.out0, python_script, code_block_6.out1)
transpose = List.Transpose(join)
byLoft = Surface.ByLoft(transpose)
python_script_2 = Python(IN[0]=translate_2, IN[1]=translate)  # same code as python_script
join_2 = List.Join(code_block_6.out0, python_script_2, code_block_6.out1)
transpose_2 = List.Transpose(join_2)
byLoft_2 = Surface.ByLoft(transpose_2)
python_script_3 = Python(IN[0]=byLoft, IN[1]=byLoft_2)  # same code as python_script
thickness = DoubleSlider(0.367, range=0..5 step 0.01)
thicken = Surface.Thicken(python_script_3, thickness)
