# Dynamo graph buckyball in a code block.dyn (Dynamo 0.7.6.3902)

number_slider = DoubleSlider(8, range=0..20 step 0.01)
# note: Turn on the preview of the code block to see the full bucky ball.  As set up, this configuration matches the visual from the email.
code_block = CodeBlock(radius=number_slider)
# ---------- code_block.designscript (70 lines) ----------
// Phi
phi = (1 + Math.Sqrt(5))/2;

// Scale factor
f = radius / Math.Sqrt(1 + 9*phi*phi);

// Sets of coordinates
s1 = f * {{-1,1}*3*phi,     0,            {-1,1}   };
s2 = f * {{-1,1}*(1+2*phi), {-1,1}*phi,   {-1,1}*2 };
s3 = f * {{-1,1}*(2+phi),   {-1,1}*2*phi, {-1,1}   };

// Points
p1 =  Point.ByCoordinates(s1[0]<2>, s1[1],    s1[2]<1>);
p2 =  Point.ByCoordinates(s2[0]<2>, s2[1]<3>, s2[2]<1>);
p3 =  Point.ByCoordinates(s3[0]<2>, s3[1]<3>, s3[2]<1>);
p3a = Point.ByCoordinates(s3[0]<1>, s3[1]<2>, s3[2]<3>);

p4 =  Point.ByCoordinates(s1[2]<1>, s1[0]<2>, s1[1]   );
p5 =  Point.ByCoordinates(s2[2]<1>, s2[0]<2>, s2[1]<3>);
p6 =  Point.ByCoordinates(s3[2]<1>, s3[0]<2>, s3[1]<3>);
p6a = Point.ByCoordinates(s3[2]<3>, s3[0]<1>, s3[1]<2>);

p7 =  Point.ByCoordinates(s1[1],    s1[2]<1>, s1[0]<2>);
p8 =  Point.ByCoordinates(s2[1]<3>, s2[2]<1>, s2[0]<2>);
p9 =  Point.ByCoordinates(s3[1]<3>, s3[2]<1>, s3[0]<2>);
p9a = Point.ByCoordinates(s3[1]<2>, s3[2]<3>, s3[0]<1>);

// All vertices
Flatten({p1,p2,p3,p4,p5,p6,p7,p8,p9});

// Edges
ax = Line.ByStartPointEndPoint(p1[0],p1[1]);
ay = Line.ByStartPointEndPoint(p4[0],p4[1]);
az = Line.ByStartPointEndPoint(p7[0],p7[1]);

bx = Line.ByStartPointEndPoint(p3[0],p3[1]);
by = Line.ByStartPointEndPoint(p6[0],p6[1]);
bz = Line.ByStartPointEndPoint(p9[0],p9[1]);

// These three lines don't work.  Instead, the next 12 must be used.
//cx = Line.ByStartPointEndPoint(p1,p2);
//cy = Line.ByStartPointEndPoint(p4,p5);
//cz = Line.ByStartPointEndPoint(p7,p8);

cx1 = Line.ByStartPointEndPoint(p1[0][0],p2[0][0]);
cx2 = Line.ByStartPointEndPoint(p1[0][1],p2[0][1]);
cx3 = Line.ByStartPointEndPoint(p1[1][0],p2[1][0]);
cx4 = Line.ByStartPointEndPoint(p1[1][1],p2[1][1]);

cy1 = Line.ByStartPointEndPoint(p4[0][0],p5[0][0]);
cy2 = Line.ByStartPointEndPoint(p4[0][1],p5[0][1]);
cy3 = Line.ByStartPointEndPoint(p4[1][0],p5[1][0]);
cy4 = Line.ByStartPointEndPoint(p4[1][1],p5[1][1]);

cz1 = Line.ByStartPointEndPoint(p7[0][0],p8[0][0]);
cz2 = Line.ByStartPointEndPoint(p7[0][1],p8[0][1]);
cz3 = Line.ByStartPointEndPoint(p7[1][0],p8[1][0]);
cz4 = Line.ByStartPointEndPoint(p7[1][1],p8[1][1]);

dx = Line.ByStartPointEndPoint(p2,p3);
dy = Line.ByStartPointEndPoint(p5,p6);
dz = Line.ByStartPointEndPoint(p8,p9);

ex = Line.ByStartPointEndPoint(p2,p9a);
ey = Line.ByStartPointEndPoint(p5,p3a);
ez = Line.ByStartPointEndPoint(p8,p6a);

// All edges
vertical = Flatten({ax,bx});
nonVert = Flatten({ay,az, by,bz, cx1,cx2,cx3,cx4, cy1,cy2,cy3,cy4, cz1,cz2,cz3,cz4, dx,dy,dz, ex,ey,ez});
# ----------------------------------------
code_block_2 = CodeBlock(p1=code_block.p1) { p1; }
watch = Watch(code_block_2)
code_block_3 = CodeBlock(p2=code_block.p2) { p2; }
watch_2 = Watch(code_block_3)
