# Dynamo graph mobius.dyn (Dynamo 0.8.1.1302)

origin = Point.Origin()
number_slider = DoubleSlider(5.573, range=0..20 step 0.1)
byCenterPointRadius = Circle.ByCenterPointRadius(centerPoint=origin, radius=number_slider)
# note: Use any even number
integer_slider = IntegerSlider(18, range=0..100 step 1)
code_block = CodeBlock(numLines=integer_slider) { 0..1..#numLines; }
pointAtParameter = Curve.PointAtParameter(curve=byCenterPointRadius, param=code_block)
ZAxis = Vector.ZAxis()
tangentAtParameter = Curve.TangentAtParameter(byCenterPointRadius, code_block)
code_block_2 = CodeBlock(numLines=integer_slider) { -90..90..#numLines; }
rotate = Vector.Rotate(ZAxis, tangentAtParameter, code_block_2)
number_slider_2 = DoubleSlider(4.561, range=0..10 step 0.1)
code_block_3 = CodeBlock(vec=rotate, width=number_slider_2) { vec.Scale(width/2); vec.Scale(-width/2); }
add = Point.Add(point=pointAtParameter, vectorToAdd=code_block_3.out0)
code_block_4 = CodeBlock(num=integer_slider) { 0..num/2; Math.Floor(num/2); }
sublists = List.Sublists(list=add, ranges=code_block_4.out0, offset=code_block_4.out1)
lastItem = List.LastItem(sublists)
byPoints = NurbsCurve.ByPoints(lastItem)
add_2 = Point.Add(point=pointAtParameter, vectorToAdd=code_block_3.out1)
sublists_2 = List.Sublists(list=add_2, ranges=code_block_4.out0, offset=code_block_4.out1)
lastItem_2 = List.LastItem(sublists_2)
byPoints_2 = NurbsCurve.ByPoints(lastItem_2)
create = List.Create(byPoints, byPoints_2)
byLoft = Surface.ByLoft(create)
firstItem = List.FirstItem(sublists)
byPoints_3 = NurbsCurve.ByPoints(firstItem)
firstItem_2 = List.FirstItem(sublists_2)
byPoints_4 = NurbsCurve.ByPoints(firstItem_2)
create_2 = List.Create(byPoints_3, byPoints_4)
byLoft_2 = Surface.ByLoft(create_2)
