# Dynamo graph NewtonRoot.dyn (Dynamo 0.8.1.1730)

formula = Formula("(x-1)*(x-2)*(x-3) + 5")
code_block = CodeBlock { start1 = 3; start2 = -30; start3 = 100; iter = 10000; }
noderiv1_1 = NewtonRootFind1DNoDeriv(formula, code_block.start1, code_block.iter)
formula_2 = Formula("(x-1)*(x-2)*(x-3) + 5")
formula_3 = Formula("3*x*x - 12*x+11")
code_block_2 = CodeBlock { start1 = 3; start2 = -30; start3 = 100; iter = 10000; }
withderiv1_1 = NewtonRootFind1DWithDeriv(formula_2, formula_3, code_block_2.start1, code_block_2.iter)
formula_4 = Formula("(x-1)*(x+2)*(x-3) - 5")
code_block_3 = CodeBlock { start1 = -30; start2 = -1; start3 = -0.5; start4 = 1; start5 = 3; iter = 10000; }
noderiv2_1 = NewtonRootFind1DNoDeriv(formula_4, code_block_3.start1, code_block_3.iter)
noderiv1_2 = NewtonRootFind1DNoDeriv(formula, code_block.start2, code_block.iter)
noderiv1_3 = NewtonRootFind1DNoDeriv(formula, code_block.start3, code_block.iter)
withderiv1_2 = NewtonRootFind1DWithDeriv(formula_2, formula_3, code_block_2.start2, code_block_2.iter)
withderiv1_3 = NewtonRootFind1DWithDeriv(formula_2, formula_3, code_block_2.start3, code_block_2.iter)
noderiv2_2 = NewtonRootFind1DNoDeriv(formula_4, code_block_3.start2, code_block_3.iter)
noderiv2_3 = NewtonRootFind1DNoDeriv(formula_4, code_block_3.start3, code_block_3.iter)
noderiv2_4 = NewtonRootFind1DNoDeriv(formula_4, code_block_3.start4, code_block_3.iter)
noderiv2_5 = NewtonRootFind1DNoDeriv(formula_4, code_block_3.start5, code_block_3.iter)
formula_5 = Formula("(x-1)*(x+2)*(x-3) - 5")
formula_6 = Formula("3*x*x - 4*x-5")
code_block_4 = CodeBlock { start1 = -30; start2 = -1; start3 = -0.5; start4 = 1; start5 = 3; iter = 10000; }
withderiv2_1 = NewtonRootFind1DWithDeriv(formula_5, formula_6, code_block_4.start1, code_block_4.iter)
withderiv2_5 = NewtonRootFind1DWithDeriv(formula_5, formula_6, code_block_4.start5, code_block_4.iter)
withderiv2_4 = NewtonRootFind1DWithDeriv(formula_5, formula_6, code_block_4.start4, code_block_4.iter)
withderiv2_2 = NewtonRootFind1DWithDeriv(formula_5, formula_6, code_block_4.start2, code_block_4.iter)
withderiv2_3 = NewtonRootFind1DWithDeriv(formula_5, formula_6, code_block_4.start3, code_block_4.iter)
