# Dynamo graph TestBoundingBox.ByGeometry.dyn (Dynamo 1.0.1.1573)

byCenterPointRadius = Circle.ByCenterPointRadius()
byGeometry = BoundingBox.ByGeometry(byCenterPointRadius)
byGeometry_2 = BoundingBox.ByGeometry(byCenterPointRadius)
