# Dynamo graph TestByUnion.dyn (Dynamo 4.0.0.2016)

code_block = CodeBlock { 10; }
byLengths = Cuboid.ByLengths(height=code_block)
byCenterPointRadius = Sphere.ByCenterPointRadius()
create = List.Create(item0=byLengths, item1=byCenterPointRadius)
byUnion = Solid.ByUnion(solids=create)
code_block_2 = CodeBlock(a=byLengths, b=byUnion) { [a,b]; }
byUnion_2 = Solid.ByUnion(solids=code_block_2)
