# Dynamo graph TestGeometry.ExportToSAT.dyn (Dynamo 1.0.1.1583)

byCenterPointRadius = Circle.ByCenterPointRadius()
code_block = CodeBlock { "exportSatTest"+1; }
exportToSAT = ExportWithUnits(byCenterPointRadius, code_block, exportedUnit=Feet)
code_block_2 = CodeBlock { "exportSatTest"+2; }
exportToSAT_2 = Geometry.ExportToSAT(byCenterPointRadius, code_block_2)
code_block_3 = CodeBlock { "exportSatTest"+3; }
code_block_4 = CodeBlock { 10000; }
exportToSAT_3 = Geometry.ExportToSAT(byCenterPointRadius, code_block_3, code_block_4)
code_block_5 = CodeBlock { "exportSatTest"+4; }
exportToSAT_4 = Geometry.ExportToSAT(byCenterPointRadius, code_block_5)
code_block_6 = CodeBlock { "exportSatTest"+5; }
exportToSAT_5 = Geometry.ExportToSAT(byCenterPointRadius, code_block_6, code_block_4)
