# Dynamo graph TestSurface.ByLoft.dyn (Dynamo 1.0.1.1580)

code_block = CodeBlock { Point.ByCoordinates(0,0,0); Point.ByCoordinates(0,0,10); Point.ByCoordinates(0,0,5); }
byCenterPointRadius = Circle.ByCenterPointRadius(centerPoint=code_block.out0)
byCenterPointRadius_2 = Circle.ByCenterPointRadius(centerPoint=code_block.out1)
create = List.Create(byCenterPointRadius, byCenterPointRadius_2)
byLoft = Surface.ByLoft(create)
byStartPointEndPoint = Line.ByStartPointEndPoint(startPoint=code_block.out0, endPoint=code_block.out1)
byLoft_2 = Surface.ByLoft(create, byStartPointEndPoint)
byStartPointEndPoint_2 = Line.ByStartPointEndPoint(startPoint=code_block.out0, endPoint=code_block.out2)
byStartPointEndPoint_3 = Line.ByStartPointEndPoint(startPoint=code_block.out2, endPoint=code_block.out1)
create_2 = List.Create(byStartPointEndPoint_2, byStartPointEndPoint_3)
byLoft_3 = Surface.ByLoft(create, create_2)
