# Dynamo graph TestSurface.Join.dyn (Dynamo 2.2.0.3727)

code_block = CodeBlock { Point.ByCoordinates(0,0,0); Point.ByCoordinates(1,0,0); Point.ByCoordinates(1,1,0); Point.ByCoordinates(0,1,0); }
create = List.Create(item0=code_block.out0, item1=code_block.out1, item2=code_block.out2, item3=code_block.out3)
byPerimeterPoints = Surface.ByPerimeterPoints(points=create)
YZ = Plane.YZ()
mirror = Geometry.Mirror(geometry=byPerimeterPoints, mirrorPlane=YZ)
byJoinedSurfaces = PolySurface.ByJoinedSurfaces(surfaces=mirror)
list_create = List.Create(item0=byJoinedSurfaces, item1=byPerimeterPoints)
byJoinedSurfaces_2 = PolySurface.ByJoinedSurfaces(surfaces=list_create)
code_block_2 = CodeBlock { Point.ByCoordinates(1,0,0); Point.ByCoordinates(2,0,0); Point.ByCoordinates(2,1,0); Point.ByCoordinates(1,1,0); }
create_2 = List.Create(item0=code_block_2.out0, item1=code_block_2.out1, item2=code_block_2.out2, item3=code_block_2.out3)
byPerimeterPoints_2 = Surface.ByPerimeterPoints(points=create_2)
create_3 = List.Create(item0=byPerimeterPoints, item1=byPerimeterPoints_2)
byJoinedSurfaces_3 = PolySurface.ByJoinedSurfaces(surfaces=create_3)
list_create_2 = List.Create(item0=byJoinedSurfaces, item1=byJoinedSurfaces_3)
byJoinedSurfaces_4 = PolySurface.ByJoinedSurfaces(surfaces=list_create_2)
