# Dynamo graph TestUnionAll.dyn (Dynamo 1.0.1.1580)

code_block = CodeBlock { 10; }
byLengths = Cuboid.ByLengths(height=code_block)
byCenterPointRadius = Sphere.ByCenterPointRadius()
unionAll = Solid.UnionAll(byLengths, byCenterPointRadius)
create = List.Create(byLengths, byCenterPointRadius)
byUnion = Solid.ByUnion(create)
