# Dynamo graph Vignette-01-Plane-Offset.dyn (Dynamo 0.8.1.1671)

# note: Designate origin on the ground plane
XY = Plane.XY()
height = IntegerSlider(20, range=0..100 step 1)
# note: Offset plane in its +Z direction create roof plane
# note: Draw roof rectangle
offset = Plane.Offset(XY, height)
width = IntegerSlider(14, range=0..100 step 1)
length = IntegerSlider(22, range=0..100 step 1)
byWidthLength = Rectangle.ByWidthLength(plane=offset, width=width, length=length)
# note: Draw ground rectangle
byWidthLength_2 = Rectangle.ByWidthLength(plane=XY, width=width, length=length)
