# Dynamo graph Vignette-01-Wireframe-Section.dyn (Dynamo 0.8.0.950)

# note: Base Plane.  This is the origin of the model.
XY = Plane.XY()
floor_2_height = DoubleSlider(30, range=20..80 step 0.1)
offset = Plane.Offset(XY, floor_2_height)
# note: Extract the point (or origin) of the ground plane.
origin = Plane.Origin(XY)
# note: Input Parameters:  These sliders control all of the flexible parameters for the conceptual wireframe model.
height = DoubleSlider(40.8, range=20..80 step 0.1)
# note: Offset the plane vertically to create the roof level.
offset_2 = Plane.Offset(XY, height)
# note: Extract the point (or origin) of the roof plane...
origin_2 = Plane.Origin(offset_2)
# note: ...Move the point in the X Direction...
XAxis = Vector.XAxis()
width = DoubleSlider(53.2, range=40..120 step 0.1)
number = DoubleInput(2)
# note: ...by a value related to the overall width.
div = width / number
translate = Geometry.Translate(geometry=origin_2, direction=XAxis, distance=div)
# note: Create a line between the origin point and the moved point.  This line represents the span, which we'll use to evaluate the Structure Angle
byStartPointEndPoint = Line.ByStartPointEndPoint(startPoint=origin_2, endPoint=translate)
structure_angle_0_1 = DoubleSlider(0.65, range=0.25..0.95 step 0.1)
# note: Evaluate points along span based on Structural Angle.
pointAtParameter = Curve.PointAtParameter(curve=byStartPointEndPoint, param=structure_angle_0_1)
# note: Create line from the origin to the evaluated point along the span.  This represents the vertical structure of the wireframe.
byStartPointEndPoint_2 = Line.ByStartPointEndPoint(startPoint=origin, endPoint=pointAtParameter)
intersect = Geometry.Intersect(geometry=offset, other=byStartPointEndPoint_2)
number_2 = DoubleInput(-1)
mul = div * number_2
translate_2 = Geometry.Translate(geometry=origin_2, direction=XAxis, distance=mul)
byStartPointEndPoint_3 = Line.ByStartPointEndPoint(startPoint=origin_2, endPoint=translate_2)
pointAtParameter_2 = Curve.PointAtParameter(curve=byStartPointEndPoint_3, param=structure_angle_0_1)
byStartPointEndPoint_4 = Line.ByStartPointEndPoint(startPoint=origin, endPoint=pointAtParameter_2)
intersect_2 = Geometry.Intersect(geometry=offset, other=byStartPointEndPoint_4)
byStartPointEndPoint_5 = Line.ByStartPointEndPoint(startPoint=intersect, endPoint=intersect_2)
floor_1_height = DoubleSlider(18.8, range=12..80 step 0.1)
# note: Offset planes to create levels.
offset_3 = Plane.Offset(XY, floor_1_height)
# note: Intersect vertical structure with Levels 1+2
intersect_3 = Geometry.Intersect(geometry=offset_3, other=byStartPointEndPoint_2)
intersect_4 = Geometry.Intersect(geometry=offset_3, other=byStartPointEndPoint_4)
# note: Draw floor lines between structural elements.
byStartPointEndPoint_6 = Line.ByStartPointEndPoint(startPoint=intersect_3, endPoint=intersect_4)
length = DoubleSlider(104.3, range=40..160 step 0.1)
byWidthLength = Rectangle.ByWidthLength(plane=XY, width=width, length=length)
# note: Create rectangles representing the ground and roof domains.
byWidthLength_2 = Rectangle.ByWidthLength(plane=offset_2, width=width, length=length)
