# Dynamo custom node Alternating List.dyf (Dynamo 0.6.2.29585)
# category: Core.Lists.Create
# Creates a list of positive and negative numbers.

# note: The number to alternate
# note: Start Positive or negative? (Boolean)
start_positive = Input()
number = DoubleInput(-1)
number_2 = Input(number)
multiply = Multiplication(number, number_2, lacing=Longest)
if_ = Conditional(start_positive, multiply, number_2)
number_3 = DoubleInput(0)
# note: The length of the list
count = Input()
number_4 = DoubleInput(1)
number_sequence = NumberSeq(number_3, count, number_4, lacing=Longest)
number_5 = DoubleInput(2)
modulo = Modulo(number_sequence, number_5, lacing=Longest)
number_6 = DoubleInput(2)
multiply_2 = Multiplication(modulo, number_6, lacing=Longest)
number_7 = DoubleInput(1)
subtract = Subtraction(multiply_2, number_7, lacing=Longest)
multiply_3 = Multiplication(if_, subtract, lacing=Longest)
Alternating_List = Output(multiply_3)
