# Dynamo custom node Approximate Ellipse with Arcs.dyf (Dynamo 0.6.2.29585)
# category: buildz
# Approximate and Ellipse with Arcs

number = DoubleInput(0)
get_from_list = GetFromList(number)
transpose_lists = Transpose()
number_2 = DoubleInput(2)
build_sublists = Sublists("0..2", arg1=number_2, lacing=Longest)
n2_pi = PiTimes2()  # "2*Pi"
number_of_arcs = Input()
formula = Formula("(x*2)+1", x=number_of_arcs, lacing=Longest)
number_3 = DoubleInput(0..a..#b, n2_pi, formula, lacing=Longest)
evaluate_curve = XyzOnCurveOrEdge(number_3, lacing=Longest)
ellipse = Input()
map = Map(evaluate_curve, ellipse)
map_2 = Map(build_sublists, map)
map_3 = Map(transpose_lists, map_2)
map_4 = Map(get_from_list, map_3)
number_4 = DoubleInput(1)
get_from_list_2 = GetFromList(number_4)
map_5 = Map(get_from_list_2, map_3)
number_5 = DoubleInput(2)
get_from_list_3 = GetFromList(number_5)
map_6 = Map(get_from_list_3, map_3)
arc_by_start_middle_end = ArcStartMiddleEnd(map_4, map_5, map_6, lacing=Longest)
arc = Output(arc_by_start_middle_end)
