# Dynamo custom node Arc Length.dyf (Dynamo 0.6.3.5244)
# category: Geometry.Curve.Query
# Returns Arc Radius

arc_s = Input()  # "arc(s)"
empty_list = Empty()
add_to_list = List(arc_s, empty_list)
flatten_completely = FlattenList(add_to_list)
python_script = Python(flatten_completely)
# ---------- python_script.python (27 lines) ----------
# Default imports
import clr
clr.AddReference('RevitAPI')
clr.AddReference('RevitAPIUI')
from Autodesk.Revit.DB import *
import Autodesk
import sys
import clr
path = r'C:\Autodesk\Dynamo\Core'
exec_path = r'C:\Autodesk\Dynamo\Core\dll'
sys.path.append(path)
sys.path.append(exec_path)
clr.AddReference('LibGNet')
from Autodesk.LibG import *

#The input to this node will be stored in the IN variable.
dataEnteringNode = IN

#query arc length
arcs = IN
arc_length = []

for i in arcs:
	arc_length.append(i.Length)

#Assign your output to the OUT variable
OUT = arc_length
# ----------------------------------------
radius_s = Output(python_script)  # "radius('s)"
