# Dynamo custom node Arcs from Curve.dyf (Dynamo 0.6.2.18294)
# category: buildz
# Create n number of near tangent arcs from an input curve

number_of_arcs = Input()
formula = Formula("x*3", x=number_of_arcs, lacing=Longest)
number = DoubleInput(0..1..#x, formula, lacing=Longest)
curve_or_edge = Input()
evaluate_curve = XyzOnCurveOrEdge(number, curve_or_edge, lacing=Longest)
first_of_list = First(evaluate_curve)
number_2 = DoubleInput(2)
number_3 = DoubleInput(1)
take_every_nth = TakeEveryNth(number_2, evaluate_curve, number_3)
add_to_list = List(first_of_list, take_every_nth)
reverse = Reverse(add_to_list)
rest_of_list = Rest(reverse)
reverse_2 = Reverse(rest_of_list)
number_4 = DoubleInput(2)
number_5 = DoubleInput(0)
take_every_nth_2 = TakeEveryNth(number_4, evaluate_curve, number_5)
arc_by_start_middle_end = ArcStartMiddleEnd(reverse_2, take_every_nth_2, take_every_nth, lacing=Longest)
arcs = Output(arc_by_start_middle_end)
