# Dynamo custom node Box.dyf (Dynamo 0.7.0.21202)
# category: buildz
# Makes a rectuangular extrusion Form Element in the Massing Environment

X = Input()
Y = Input()
Z = Input()
Width = Input()
Length = Input()
Rotation_Radians = Input()  # "Rotation(Radians)"
Height = Input()
geometry_box = Custom[Geometry Box](X=X, Y=Y, Z=Z, Width=Width, Length=Length, Rotation_Radians=Rotation_Radians, Height=Height)  # Creates a geometric box. Needs a freeform element node to make a Revit Element
free_form = FreeForm(geometry_box, lacing=Longest)
