# Dynamo custom node Closest Point (CP) Simple.dyf (Dynamo 0.6.2.22517)
# category: Geometry.Point.Query
# Find closest point in a point collection.
# Output only points (no indexes or distances)

P = Input()
min_distance_function = Custom[Min Distance Function](list=P)  # Use with Map to get Closest Point between collections XYZ
C = Input()
map = Map(min_distance_function, C)
point_list = Output(map)
