# Dynamo custom node Min Distance Function.dyf (Dynamo 0.6.2.22517)
# category: Geometry.Point.Query
# Use with Map to get Closest Point between collections XYZ

free = Input()
xyz_distance = XyzDistance(free, lacing=Longest)
xyz_list = Input()
list_minimum = ListMin(xyz_distance, xyz_list)
min = Output(list_minimum)
