# Dynamo custom node Compute Centroid.dyf (Dynamo 0.6.3.7993)
# category: JBE
# Compute the centroid of an element - alpha version for single material element

Element_s = Input()  # "Element(s)"
solid_from_element = ElementSolid(Element_s, lacing=Longest)
turn_into_list = Custom[Turn Into List](item=solid_from_element)  # Turns an element into a (flat) list
python_script = Python(turn_into_list)
# ---------- python_script.python (26 lines) ----------
# Default imports
import clr
clr.AddReference('RevitAPI')
clr.AddReference('RevitAPIUI')
from Autodesk.Revit.DB import *
import Autodesk
import sys
import clr
path = r'C:\Autodesk\Dynamo\Core'
exec_path = r'C:\Autodesk\Dynamo\Core\dll'
sys.path.append(path)
sys.path.append(exec_path)
clr.AddReference('LibGNet')
from Autodesk.LibG import *

solids = IN
b=[]
d=[]
for item in solids:
	try:
		a=item.ComputeCentroid()
		b.append(a)
	except:
		0

OUT = b
# ----------------------------------------
XYZ = Output(python_script)
