# Dynamo custom node Compute Ratio between Columns.dyf (Dynamo 0.6.3.7993)
# category: CEE120
# Computes the ratio between the values in two input columns and adds it as a last column

number = DoubleInput(0)
rowIndex = Input()
hierarchicalList = Input()
get_row_values_from_list = GetFromList(rowIndex, hierarchicalList)
get_from_list = GetFromList(number, get_row_values_from_list)
columnIndexOfNumerator = Input()
numeratorValue = GetFromList(columnIndexOfNumerator, get_row_values_from_list)
columnIndexOfDenominator = Input()
denominatorValue = GetFromList(columnIndexOfDenominator, get_row_values_from_list)
formula = Formula("numerator/denominator", numerator=numeratorValue, denominator=denominatorValue, lacing=Longest)
list = NewList(index0=get_from_list, index1=numeratorValue, index2=denominatorValue, index3=formula)
rowWithRatioInColumn3 = Output(list)
