# Dynamo custom node Concat List of Strings.dyf (Dynamo 0.6.3.38253)
# category: Core.Strings
# Concatenate Two or More List of Strings

Nested_List = Input()
transpose_lists = Transpose(Nested_List)
Spacer_String = Input()
python_script_with_variable = Python(transpose_lists, Spacer_String)  # "Python Script With Variable Number of Inputs"
# ---------- python_script_with_variable.python (28 lines) ----------
# Default imports
import clr
clr.AddReference('RevitAPI')
clr.AddReference('RevitAPIUI')
from Autodesk.Revit.DB import *
import Autodesk
import sys
import clr
path = r'C:\Autodesk\Dynamo\Core'
exec_path = r'C:\Autodesk\Dynamo\Core\dll'
sys.path.append(path)
sys.path.append(exec_path)
clr.AddReference('LibGNet')
from Autodesk.LibG import *

#The input to this node will be stored in the IN0...INX variable(s).

a = IN0
b = IN1 
newlst = []
c = len(a)

for i in range(0,c):
	d = a[i]
	newlst.append(b.join(d))

#Assign your output to the OUT variable
OUT = newlst
# ----------------------------------------
Output = Output(python_script_with_variable)  # ""
