# Dynamo custom node Concatenate File Header String.dyf (Dynamo 0.6.3.7993)
# category: CEE120.Session11
# Concatenates Values into a File Header String

descriptionString = Input()
string = StringInput(": ")
startingValue = Input()
number_to_string = Num2String(startingValue, lacing=Longest)
string_2 = StringInput(" to ")
endingValue = Input()
number_to_string_2 = Num2String(endingValue, lacing=Longest)
concat_strings = ConcatStrings(s3=descriptionString, s4=string, s5=number_to_string, string_2, number_to_string_2)
fileHeaderString = Output(concat_strings)
