# Dynamo custom node Convert CSV Text to Hierarchical Lists.dyf (Dynamo 0.6.3.7993)
# category: CEE120.Session11
# Converts a CSV Text String into Hierarchical Lists -- a list of rows with sublists for values in each row

string_to_number = String2Num(lacing=Longest)
comma_delimiter = StringInput(",")
split_string = SplitString(arg1=comma_delimiter)
firstRowHeader = Input()
index_of_first_row_if_header = DoubleInput(1)
index_of_first_row_if_no_header = DoubleInput(0)
if_ = Conditional(firstRowHeader, index_of_first_row_if_header, index_of_first_row_if_no_header)
CSVTextString = Input()
carraige_return_delimiter = StringInput("\n")
split_string_2 = SplitString(CSVTextString, carraige_return_delimiter)
list_length = Length(split_string_2)
index_of_last_row = Formula("length-1", length=list_length, lacing=Longest)
number = DoubleInput(1)
indexes_of_rows_number_range = NumberRange(if_, index_of_last_row, number, lacing=Longest)
get_from_list = GetFromList(indexes_of_rows_number_range, split_string_2)
map = Map(split_string, get_from_list)
map_2 = Map(string_to_number, map)
HeirarchicalList = Output(map_2)
