# Dynamo custom node List of Numbers from Comma-Delimited String.dyf (Dynamo 0.6.2.29585)
# category: Core.Lists.Create
# Converts a string of comma-delimited numbers into a list of numbers

Comma_delimited_list_of_numbers = Input()  # "Comma-delimited list of numbers"
string = StringInput(",")
split_string = SplitString(Comma_delimited_list_of_numbers, string)
string_to_number = String2Num(split_string, lacing=Longest)
List = Output(string_to_number)
