# Dynamo custom node List of Strings from Comma-Delimited String.dyf (Dynamo 0.6.2.29585)
# category: Core.Lists.Create
# Create a list of strings from a single comma-delimited string

Comma_delimited_String = Input()  # "Comma-delimited String"
string = StringInput(",")
split_string = SplitString(Comma_delimited_String, string)
python_script = Python(split_string)
# ---------- python_script.python (23 lines) ----------
# Default imports
import clr
clr.AddReference('RevitAPI')
clr.AddReference('RevitAPIUI')
from Autodesk.Revit.DB import *
import Autodesk
import sys
import clr
path = r'C:\Autodesk\Dynamo\Core'
exec_path = r'C:\Autodesk\Dynamo\Core\dll'
sys.path.append(path)
sys.path.append(exec_path)
clr.AddReference('LibGNet')
from Autodesk.LibG import *

#The input to this node will be stored in the IN variable.
listOfStrings = IN

for n in range( len(listOfStrings) ):
	listOfStrings[n] = listOfStrings[n].strip()

#Assign your output to the OUT variable
OUT = listOfStrings
# ----------------------------------------
List = Output(python_script)
