# Dynamo custom node Create N views from Active view type.dyf (Dynamo 0.6.3.7993)
# category: JBE
# Create N views from Active view type

View = Input()
N_Number = Input()
python_script_with_variable = Python(View, N_Number)  # "Python Script With Variable Number of Inputs"
# ---------- python_script_with_variable.python (30 lines) ----------
# Default imports
import clr
clr.AddReference('RevitAPI')
clr.AddReference('RevitAPIUI')
from Autodesk.Revit.DB import *
import Autodesk
import sys
import clr
path = r'C:\Autodesk\Dynamo\Core'
exec_path = r'C:\Autodesk\Dynamo\Core\dll'
sys.path.append(path)
sys.path.append(exec_path)
clr.AddReference('LibGNet')
from Autodesk.LibG import *

#The input to this node will be stored in the IN0...INX variable(s).
doc = __doc__

view = IN0
number = IN1
viewlist = []
typeid=View.GetTypeId(view)
count = 0
while (count < number):
	b=View3D.CreateIsometric(doc, typeid)
	viewlist.append(b)
	count = count + 1

#Assign your output to the OUT variable
OUT = viewlist
# ----------------------------------------
Views = Output(python_script_with_variable)
