# Dynamo custom node Create Room Level_UV.dyf (Dynamo 0.6.3.7993)
# category: JBE
# Create a new room at Level and UV(XY) in the active view

revit_document = RevitDocument(lacing=Longest)
Level = Input()
UV_s = Input()  # "UV(s)"
turn_into_list = Custom[Turn Into List](item=UV_s)  # Turns an element into a (flat) list
python_script_with_variable = Python(revit_document, Level, turn_into_list)  # "Python Script With Variable Number of Inputs"
# ---------- python_script_with_variable.python (27 lines) ----------
# Default imports
import clr
clr.AddReference('RevitAPI')
clr.AddReference('RevitAPIUI')
from Autodesk.Revit.DB import *
import Autodesk
import sys
import clr
path = r'C:\Autodesk\Dynamo\Core'
exec_path = r'C:\Autodesk\Dynamo\Core\dll'
sys.path.append(path)
sys.path.append(exec_path)
clr.AddReference('LibGNet')
from Autodesk.LibG import *

#The input to this node will be stored in the IN0...INX variable(s).
doc = IN0
level = IN1
uv = IN2
roomlist=[]
for item in uv:
	doccreation = doc.Create
	a=doccreation.NewRoom(level,item)
	roomlist.append(a)

#Assign your output to the OUT variable
OUT = roomlist
# ----------------------------------------
Room_s = Output(python_script_with_variable)  # "Room(s)"
