# Dynamo custom node Create Unplaced Room at Phase.dyf (Dynamo 0.6.3.21482)
# category: JBE
# Create unplaced rooms at given phase(s)

revit_document = RevitDocument(lacing=Longest)
Phase_s = Input()  # "Phase(s)"
turn_into_list = Custom[Turn Into List](item=Phase_s)  # Turns an element into a (flat) list
python_script_with_variable = Python(revit_document, turn_into_list)  # "Python Script With Variable Number of Inputs"
# ---------- python_script_with_variable.python (26 lines) ----------
# Default imports
import clr
clr.AddReference('RevitAPI')
clr.AddReference('RevitAPIUI')
from Autodesk.Revit.DB import *
import Autodesk
import sys
import clr
path = r'C:\Autodesk\Dynamo\Core'
exec_path = r'C:\Autodesk\Dynamo\Core\dll'
sys.path.append(path)
sys.path.append(exec_path)
clr.AddReference('LibGNet')
from Autodesk.LibG import *

#The input to this node will be stored in the IN0...INX variable(s).
doc = IN0
phases = IN1
roomlist=[]
for item in phases:
	doccreation = doc.Create
	a=doccreation.NewRoom(item)
	roomlist.append(a)

#Assign your output to the OUT variable
OUT = roomlist
# ----------------------------------------
Unplaced_Room_s = Output(python_script_with_variable)  # "Unplaced Room(s)"
