# Dynamo custom node Curve Loop By Circle.dyf (Dynamo 0.6.3.22045)
# category: Geometry.Curve.Create
# Creates a curve loop from a circle so that it can be used with other nodes (e.g. sweep)

list = NewList()
# note: Curve Loop By Circle
# By Wassim Jabi (wassim.jabi@gmail.com)
# (c) 2014. All rights reserved.
# This software is provided 'as is' without warranty of any kind, either express or implied, including, but not limited to, the implied warranties of fitness for a purpose, or the warranty of non-infringement.
# This was derived from the excellent work of Zach Kron.
center = Input()
radius = Input()
number = DoubleInput(0)
pi = Pi()
arc_by_center_radius_parameters = ArcCenter(center, radius, number, pi, lacing=Longest)
list_2 = NewList(index0=arc_by_center_radius_parameters)
flatten_completely = FlattenList(list_2)
n2_pi = PiTimes2()  # "2*Pi"
arc_by_center_radius_parameters_2 = ArcCenter(center, radius, pi, n2_pi, lacing=Longest)
list_3 = NewList(index0=arc_by_center_radius_parameters_2)
flatten_completely_2 = FlattenList(list_3)
combine = Combine(list, flatten_completely, flatten_completely_2)
curve_loop = CurveLoop(combine, lacing=Longest)
CurveLoop = Output(curve_loop)
