# Dynamo custom node Round To Precision.dyf (Dynamo 0.6.3.5260)
# category: CAAD_RWTH.Math.Rounding
# Rounds a number to a specified precision

Number = Input()
Precision = Input()
formula = Formula("Round(a/b,0)*b", a=Number, b=Precision, lacing=Longest)
round = Output(formula)
