# Dynamo custom node Round Up To Precision.dyf (Dynamo 0.6.3.5260)
# category: CAAD_RWTH.Math.Rounding
# Rounds a number *up* to a specified precision

Number = Input()
Precision = Input()
formula = Formula("ceiling(a/b)*b", a=Number, b=Precision, lacing=Longest)
Ceiling = Output(formula)
