# Dynamo custom node Cylinder.dyf
# category: buildz
# Makes a Cylinder in the Massing Environment

boolean = BoolSelector(true)
X = Input()
Y = Input()
Z_start = Input()
Z_end = Input()
list = NewList(index0=Z_start, index1=Z_end)
XYZ = Xyz(X, Y, list, lacing=Longest)
rad = Input()
circle = Circle(XYZ, rad, lacing=Longest)
reference_curve = ReferenceCurve(circle, lacing=Longest)
boolean_2 = BoolSelector(false)
loft_form = LoftForm(boolean, reference_curve, boolean_2, FormId=30968, PreferSurfaceForOneLoop=false, lacing=Longest)
