# Dynamo custom node Diagrid.dyf (Dynamo 0.6.2.29585)
# category: Geometry.Surface.Divide
# Creates a diagrid from a surface. Outputs UV, XYZ, facet points, and facets

number = DoubleInput(2)
# note: Get the first list of the output (UV)
number_2 = DoubleInput(0)
# note: face: The selected face/surface
# note: Diagrid
# By Wassim Jabi (wassim.jabi@gmail.com)
# (c) 2014. All rights reserved.
# This software is provided 'as is' without warranty of any kind, either express or implied, including, but not limited to, the implied warranties of fitness for a purpose, or the warranty of non-infringement.
face = Input()
get_surface_domain = SurfaceDomain(face, lacing=Longest)
# note: Integer: Number of U subdivisions
U_Count = Input()  # "U-Count"
# note: Integer: Number of V subdivisions
V_Count = Input()  # "V-Count"
# note: This python script is based on a 3ds Max (MAXSCRIPT) from my book "Parametric Design for Architecture"
# note: Boolean: To rotate the orientation of the diagrid
rotate = Input()
list = NewList(index0=get_surface_domain, index1=U_Count, index2=V_Count, index3=face, index4=rotate)
python_script_build_vertices_and = Python(list)  # "Python Script (Build Vertices and Faces)"
# ---------- python_script_build_vertices_and.python (110 lines) ----------
# Default imports
import clr
clr.AddReference('RevitAPI')
clr.AddReference('RevitAPIUI')
from Autodesk.Revit.DB import *
import Autodesk
import sys
import clr
path = r'C:\Autodesk\Dynamo\Core'
exec_path = r'C:\Autodesk\Dynamo\Core\dll'
sys.path.append(path)
sys.path.append(exec_path)
clr.AddReference('LibGNet')
from Autodesk.LibG import *
import math
#The input to this node will be stored in the IN variable.
domain = IN[0]
uCount = IN[1]
vCount = IN[2]
face = IN[3]
rotated = IN[4]
nr = int(uCount*2)
nc = int(vCount)
outputList = []
vertexList = []
faceList = []


if uCount > 0 and vCount > 0:
	uUnit = float(domain.USpan/float(nc))
	vUnit = float(domain.VSpan/float(nr))

	# Create Vertices
	for aRow in range(0,int(nr + 1),1):
		if aRow%2 == 0:
			hoffset = 0.0
			deduct = int(0)
		else:
			hoffset = 0.5
			deduct = int(1)
		for aColumn in range(int(nc - deduct) + 1):
			aPoint = []
			u = float(aRow)*vUnit
			v = float(aColumn + hoffset)*uUnit
			# aPoint.append(u)
			# aPoint.append(v)
			if (rotated):
				vertexList.append(v)
				vertexList.append(u)
			else:
				vertexList.append(u)
				vertexList.append(v)

	# Create first set of faces
	for aRow in range(1,(nr + 1),2):
		for aColumn in range(1,(nc + 1),1):
			v1 = (aRow - 1)*(nc + 1) - ((aRow - 1)/2) + aColumn
			v2 = (aRow - 1)*(nc + 1) - ((aRow - 1)/2) + aColumn + 1
			v3 = (aRow - 1)*(nc + 1) - ((aRow - 1)/2) + aColumn + (nc + 1)
			faceList.append(v1 - 1)
			faceList.append(v2 - 1)
			faceList.append(v3 - 1)
			
			if (aColumn < nc):
				v1 = (aRow - 1)*(nc + 1) - ((aRow - 1)/2) + aColumn + (nc + 1)
				v2 = (aRow - 1)*(nc + 1) - ((aRow - 1)/2) + aColumn + 1
				v3 = (aRow - 1)*(nc + 1) - ((aRow - 1)/2) + aColumn + (nc + 2)
				faceList.append(v1 - 1)
				faceList.append(v2 - 1)
				faceList.append(v3 - 1)

	# Create second set of faces
	for aRow in range(3,(nr + 2),2):
		for aColumn in range(1,(nc + 1),1):
			v1 = (aRow - 1)*(nc + 1) - ((aRow - 1)/2) + aColumn + 1
			v2 = (aRow - 1)*(nc + 1) - ((aRow - 1)/2) + aColumn
			v3 = (aRow - 3)*(nc + 1) - ((aRow - 3)/2) + aColumn + (nc + 1)
			faceList.append(v1 - 1)
			faceList.append(v2 - 1)
			faceList.append(v3 - 1)
			
			if (aColumn < nc):
				v1 = (aRow - 3)*(nc + 1) - ((aRow - 3)/2) + aColumn + (nc + 1)
				v2 = (aRow - 3)*(nc + 1) - ((aRow - 3)/2) + aColumn + 1 + (nc + 1)
				v3 = (aRow - 1)*(nc + 1) - ((aRow - 1)/2) + aColumn + 1
				faceList.append(v1 - 1)
				faceList.append(v2 - 1)
				faceList.append(v3 - 1)

	# Create left and right triangular edges			
	for aRow in range(1,(nr + 1),2):
		v1 = (aRow - 1)*(nc + 1) - ((aRow - 1)/2) + 1
		v2 = (aRow - 1)*(nc + 1) - ((aRow - 1)/2) + 1 + (nc + 1)
		v3 = (aRow + 1)*(nc + 1) - ((aRow + 1)/2) + 1
		faceList.append(v1 - 1)
		faceList.append(v2 - 1)
		faceList.append(v3 - 1)
		
		v1 = (aRow + 1)*(nc + 1) - ((aRow + 1)/2) + nc + 1
		v2 = (aRow - 1)*(nc + 1) - ((aRow - 1)/2) + nc + (nc + 1)
		v3 = (aRow - 1)*(nc + 1) - ((aRow - 1)/2) + nc + 1
		faceList.append(v1 - 1)
		faceList.append(v2 - 1)
		faceList.append(v3 - 1)
	#Assign your output to the OUT variable
	outputList.append(vertexList)
	outputList.append(faceList)
	OUT = outputList
else:
	OUT = []
# ----------------------------------------
get_from_list = GetFromList(number_2, python_script_build_vertices_and)
number_3 = DoubleInput(0)
# note: Split the master UV list into a U and a V lists.
drop_every_nth = RemoveEveryNth(number, get_from_list, number_3)
take_every_nth = TakeEveryNth(number, get_from_list, number_3)
UV = Uv(drop_every_nth, take_every_nth, lacing=Longest)
# note: Use the UV list to get the XYZ coordinates from the surface
evaluate_surface = XyzEvaluate(UV, face, lacing=Longest)
number_4 = DoubleInput(1)
# note: Get the second list of the output (pointers to XYZ coordinates)
get_from_list_2 = GetFromList(number_4, python_script_build_vertices_and)
# note: Feed the two lists to the two python scripts to build list of triangle vertices (list of lists)
number_5 = DoubleInput(3)
build_sublists = Sublists("0..2", get_from_list_2, number_5, lacing=Longest)
list_2 = NewList(index0=evaluate_surface, index1=build_sublists)
python_script_3_point = Python(list_2)
# ---------- python_script_3_point.python (32 lines) ----------
# Default imports
import clr
clr.AddReference('RevitAPI')
clr.AddReference('RevitAPIUI')
from Autodesk.Revit.DB import *
import Autodesk
import sys
import clr
path = r'C:\Autodesk\Dynamo\Core'
exec_path = r'C:\Autodesk\Dynamo\Core\dll'
sys.path.append(path)
sys.path.append(exec_path)
clr.AddReference('LibGNet')
from Autodesk.LibG import *

# The input to this node will be stored in the IN variable.
vertexList = IN[0]
faceList = IN[1]
outputList = []
numFaces = len(faceList)

for i in range(0,numFaces,1):
	currentFace = faceList[i]
	v1 = vertexList[int(currentFace[0])]
	v2 = vertexList[int(currentFace[1])]
	v3 = vertexList[int(currentFace[2])]
	outputList.append(v1)
	outputList.append(v2)
	outputList.append(v3)

#Assign your output to the OUT variable
OUT = outputList
# ----------------------------------------
number_6 = DoubleInput(3)
build_sublists_2 = Sublists("0..2", python_script_3_point, number_6, lacing=Longest)
# note: list: A list of the 3 points for each triangle. Use with facet
facet_points = Output(build_sublists_2)
# note: list: A list of the diagrid XYZ coordinates
XYZ = Output(evaluate_surface)
# note: list: A list of the diagrid U and V coordinates
UV_2 = Output(UV)  # "UV"
python_script_4_point = Python(list_2)
# ---------- python_script_4_point.python (33 lines) ----------
# Default imports
import clr
clr.AddReference('RevitAPI')
clr.AddReference('RevitAPIUI')
from Autodesk.Revit.DB import *
import Autodesk
import sys
import clr
path = r'C:\Autodesk\Dynamo\Core'
exec_path = r'C:\Autodesk\Dynamo\Core\dll'
sys.path.append(path)
sys.path.append(exec_path)
clr.AddReference('LibGNet')
from Autodesk.LibG import *

# The input to this node will be stored in the IN variable.
vertexList = IN[0]
faceList = IN[1]
outputList = []
numFaces = len(faceList)

for i in range(0,numFaces,1):
	currentFace = faceList[i]
	v1 = vertexList[int(currentFace[0])]
	v2 = vertexList[int(currentFace[1])]
	v3 = vertexList[int(currentFace[2])]
	outputList.append(v1)
	outputList.append(v2)
	outputList.append(v3)
	outputList.append(v1)

#Assign your output to the OUT variable
OUT = outputList
# ----------------------------------------
# note: These two python scripts build a list of triangle vertices. 3 Points for facets and 4 points for triangle lines (1st and 4th are same point).
number_7 = DoubleInput(4)
build_sublists_3 = Sublists("0..3", python_script_4_point, number_7, lacing=Longest)
# note: list: A list of the 4 points for each triangle. Use with line through points
line_points = Output(build_sublists_3)
