# Dynamo custom node Lookup.dyf (Dynamo 0.7.0.26170)
# category: Core.Lists
# Locates the first element of the given list whose car is equal to v. If such an element exists, the pair (i.e., an element of the given list) is returned. Otherwise, the result is false.

list = Input()
is_empty_list = IsEmpty(list)
boolean = BoolSelector(false)
key = Input()
split_list = DeCons(list)
first_of_list = First(split_list.out0)
equal = Equal(key, first_of_list)
# note: ...and if the first element in the first element of the list matches the key, we return the key/value pair.
# note: ...and if the first element in the first element of the list does not match the key, we look through the rest of the list.
lookup = Custom[Lookup](key=key, list=split_list.out1)  # Locates the first element of the given list whose car is equal to v. If such an element exists, the pair (i.e., an element of the given list) is returned. Otherwise, the result is false.
# note: If the list is not empty...
if_ = Conditional(equal, split_list.out0, lookup)
# note: If the list is empty, then we could not find the key, and return false.
if_2 = Conditional(is_empty_list, boolean, if_)
pair = Output(if_2)
