# Dynamo custom node Create Skymodel and Environment.dyf (Dynamo 0.6.3.25815)
# category: Misc
# Creates a skymodel and environment for daylight render, returns the environment object

skymodel_type = SkymodelType(index=0)
DHI = Input()
DNI = Input()
GHI = Input()
daylighting_skymodel = MakeDaylightingSkyModel(skymodel_type, DHI, DNI, GHI, lacing=Longest)
loc_x = Input()
loc_y = Input()
datatime_object = Input()
daylighting_environment = MakeDaylightingEnvironmentData(daylighting_skymodel, loc_x, loc_y, datatime_object, lacing=Longest)
