# Dynamo custom node DynamoLogger.Log().dyf (Dynamo 0.6.3.30451)
# category: Debug
# Uses the DynamoLogger and FSchemeInterop Utils class to print to the console

input = Input()
python_script = Python(input)
# ---------- python_script.python (53 lines) ----------
# Default imports
import clr
clr.AddReference('RevitAPI')
clr.AddReference('RevitAPIUI')
from Autodesk.Revit.DB import *
import Autodesk
import sys
import clr

path = r'C:\Autodesk\Dynamo\Core'
sys.path.append(path)
clr.AddReference('DynamoPython')
clr.AddReference('DynamoCore')
clr.AddReference('FSchemeInterop')
clr.AddReference('FScheme')
clr.AddReference('System')
exec_path = r'C:\Autodesk\Dynamo\Core\dll'
sys.path.append(exec_path)
import Dynamo
clr.AddReference('FSharp.Core')
import System
#from DynamoPython import Converters
#The input to this node will be stored in the IN variable.
import DynamoPython
import System.Reflection
from Dynamo import DynamoLogger




x = IN

z=""

def rec_increment(p,z):
	
	if len(p) == 0:
		return
	else:
		r = list(p)
		z += str( r.pop(0)) + '\n'
		return rec_increment(r,z)

#z = rec_increment(x,z)


#y = ""
#for item in x:
#	y += (str(item)+"\n")
#DynamoLogger.Instance.Log(Dynamo.FSchemeInterop.Utils.Print(x))

DynamoLogger.Instance.Log(str(x))
OUT = z
# ----------------------------------------
object = Output(input)
