# Dynamo custom node New Sketch Plane.dyf (Dynamo 0.6.3.28490)
# category: Create Geometry.Surface

xyz_basisz = XyzBasisZ(lacing=Longest)
XYZ = Xyz(lacing=Longest)
plane = Plane(xyz_basisz, XYZ, lacing=Longest)
sketch_plane = SketchPlane(plane, lacing=Longest)
