# Dynamo custom node Within Range.dyf (Dynamo 0.6.3.26148)
# category: Misc

x = Input()
less_than = Input()
less_than_2 = LessThan(x, less_than)
greater_than = Input()
greater_than_2 = GreaterThan(x, greater_than)
and_ = And(less_than_2, greater_than_2)
