# Dynamo custom node laceBackwards.dyf
# Copyright 2012 Ian Keough
# Licensed under the Apache License, Version 2.0 (the "License");
# you may not use this file except in compliance with the License.
# You may obtain a copy of the License at
# http://www.apache.org/licenses/LICENSE-2.0
# Unless required by applicable law or agreed to in writing, software
# distributed under the License is distributed on an "AS IS" BASIS,
# WITHOUT WARRANTIES OR CONDITIONS OF ANY KIND, either express or implied.
# See the License for the specific language governing permissions and
# limitations under the License.
# category: Core.Lists

lst = Input()
count = Length(lst)
number = DoubleInput(2)
lt = LessThan(count, number)
empty = Empty()
curve_by_points = CurveByPoints()
list = NewList()
number_2 = DoubleInput(1)
number_3 = DoubleInput(0)
number_4 = DoubleInput(2)
take = TakeList(number_4, lst)
get = GetFromList(number_3, take)
drop = DropList(number_2, get)
get_2 = GetFromList(number_2, take)
reverse = Reverse(get_2)
drop_2 = DropList(number_2, reverse)
reverse_2 = Reverse(drop_2)
combine = Combine(list, drop, reverse_2)
map = Map(curve_by_points, combine)
drop_3 = DropList(number_2, lst)
laceForward = Function(drop_3)
cons = List(map, laceForward)
if_ = Conditional(lt, empty, cons)
