# Dynamo custom node Eraser by Name.dyf (Dynamo 0.6.3.7993)
# category: JBE
# Erase things matching a Regular expression

revit_document = RevitDocument(lacing=Longest)
Things_list = Input()  # "Things(list)"
turn_into_list = Custom[Turn Into List](item=Things_list)  # Turns an element into a (flat) list
Name_as_jocker_Blank_for_All = Input()  # "Name (*as jocker / Blank for All)"
# note: Node created from this discussion:
# http://dynamobim.org/forums/topic/tool-purge-line-pattern-available-as-package/
# note: Idea: Julien Benoit
# Python code: Andreas Dieckmann
get_name = Custom[Get Name](element_s=turn_into_list)  # Gets the name of a given Revit element (if possible)
match_regular_expression = Custom[Match Regular Expression](regex=Name_as_jocker_Blank_for_All, string_s=get_name)  # Determines if a regular expression matches a string (or a list of strings) and returns a boolean value (or a list, depending on the input). The syntax for regular expressions is explained at http://ironpython-test.readthedocs.org/en/latest/howto/regex.html
filter_by_boolean_mask = FilterMask(turn_into_list, match_regular_expression)
eraser = Python(revit_document, filter_by_boolean_mask)
# ---------- eraser.python (25 lines) ----------
# Default imports
import clr
clr.AddReference('RevitAPI')
clr.AddReference('RevitAPIUI')
from Autodesk.Revit.DB import *
import Autodesk
import sys
import clr
path = r'C:\Autodesk\Dynamo\Core'
exec_path = r'C:\Autodesk\Dynamo\Core\dll'
sys.path.append(path)
sys.path.append(exec_path)
clr.AddReference('LibGNet')
from Autodesk.LibG import *

doc = IN0
x= IN1
cantdelete=[]
for item in x:
	try:
		doc.Delete(item)
	except:
		cantdelete.append(item)
		
OUT = cantdelete
# ----------------------------------------
transaction = Transaction(eraser)
Can_t_Delete = Output(transaction)  # "Can't Delete"
