# Dynamo custom node Evaluate Sun Directness - Raw Distances.dyf (Dynamo 0.6.3.7993)
# category: CEE120
# Returns values from 0 to 1 based on orientation relative to sun path

Quads = Input()
best_fit_plane = BestFitPlane(Quads, lacing=Longest)
SunPath = Input()
number = DoubleInput(1)
scale_xyz = XyzScale(SunPath, number, lacing=Longest)
direction_to_xyz = XyzStartEndVector(best_fit_plane.out2, scale_xyz, lacing=Longest)
xyz_distance = XyzDistance(direction_to_xyz, best_fit_plane.out1, lacing=Longest)
flatten_completely = FlattenList(xyz_distance)
sort = Sort(xyz_distance)
first_of_list = First(sort)
last_of_list = Last(sort)
formula = Formula("1-((x-Lowest)/(Highest-Lowest))", x=flatten_completely, Lowest=first_of_list, Highest=last_of_list, lacing=Longest)
DirectnessValues = Output(formula)
watch = Watch(flatten_completely)
formula_2 = Formula("input / 1'", input=watch, lacing=Longest)
rawDistanceValues = Output(formula_2)
watch_2 = Watch(xyz_distance)
watch_3 = Watch(sort)
watch_4 = Watch(first_of_list)
watch_5 = Watch(last_of_list)
watch_6 = Watch(formula)
average = Average(formula_2, lacing=Longest)
watch_7 = Watch(average)
