# Dynamo custom node Exterior Angle.dyf (Dynamo 0.6.3.5260)
# category: CAAD_RWTH.Math.Formulas
# Computes the exterior angle of a given angle.

angle = Input()
formula = Formula("2*Pi-angle", angle=angle, lacing=Longest)
n360_angle = Output(formula)  # "360°-angle"
formula_2 = Formula("Pi-angle", angle=angle, lacing=Longest)
n180_angle = Output(formula_2)  # "180°-angle"
