# Dynamo custom node FAR Color Overrides.dyf (Dynamo 0.6.3.21482)
# category: sdb Tools
# Calculates the Floor Area Ratio of a Mass (building) to a Surface (site)

Select_Site_Face = Input()
Select_Building_Mass = Input()
floor_area_ratio = Custom[Floor Area Ratio](Select_Site_Face=Select_Site_Face, Select_Building_Mass=Select_Building_Mass)  # Floor Area Ratio calculator
watch = Watch(floor_area_ratio)
Max_FAR = Input()
greater_than = GreaterThan(watch, Max_FAR)
red = Custom[Red]()  # Returns the colour red.
green = Custom[Green]()  # Returns the colour green.
if_ = Conditional(greater_than, red, green)
override_element_color_in_view = OverrideColorInView(if_, Select_Building_Mass, lacing=Longest)
Color = Output(override_element_color_in_view)
string = StringInput("FAR = ")
number_to_string = Num2String(floor_area_ratio, lacing=Longest)
concat_strings = ConcatStrings(string, number_to_string)
watch_2 = Watch(concat_strings)
Actual_FAR = Output(watch_2)
