# Dynamo custom node FAR.dyf (Dynamo 0.6.2.20449)
# category: NBBJ
# Floor Area Ratio calculator

Select_Building_Mass = Input()
string = StringInput("Gross Floor Area")
get_family_instance_parameter = FamilyInstanceParameterGetter(Select_Building_Mass, string, lacing=Longest)  # "Get Family Instance Parameter Value"
Select_Site_Face = Input()
surface_area = SurfaceArea(Select_Site_Face, lacing=Longest)
divide = Division(get_family_instance_parameter, surface_area, lacing=Longest)
FAR = Output(divide)
