# Dynamo custom node Family Transform.dyf (Dynamo 0.6.3.7993)
# category: Revit.Families
# Extracts transformation matrix from family instance.

fi_transaction = Input()
family_transform = Python(fi_transaction)
# ---------- family_transform.python (26 lines) ----------
# Default imports
import clr
clr.AddReference('RevitAPI')
clr.AddReference('RevitAPIUI')
from Autodesk.Revit.DB import *
import Autodesk
import sys
import clr
path = r'C:\Autodesk\Dynamo\Core'
exec_path = r'C:\Autodesk\Dynamo\Core\dll'
sys.path.append(path)
sys.path.append(exec_path)
clr.AddReference('LibGNet')
from Autodesk.LibG import *

#The input to this node will be stored in the IN variable.
dataEnteringNode = IN

fam_inst = IN
result = []

for i in fam_inst:
	result.append(i.GetTransform())

#Assign your output to the OUT variable
OUT = result
# ----------------------------------------
transform = Output(family_transform)
