# Dynamo custom node Fibonacci Python Code.dyf (Dynamo 0.6.1.18684)
# category: Scripting.Python
# Python to make fibonacci sequence

IN = Input()
fibonacci_sequence = Python(IN)
# ---------- fibonacci_sequence.python (45 lines) ----------
# Default imports
import clr
clr.AddReference('RevitAPI')
clr.AddReference('RevitAPIUI')
from Autodesk.Revit.DB import *
import Autodesk
import sys
import clr
path = r'C:\Autodesk\Dynamo\Core'
exec_path = r'C:\Autodesk\Dynamo\Core\dll'
sys.path.append(path)
sys.path.append(exec_path)
clr.AddReference('LibGNet')
from Autodesk.LibG import *

#The input to this node will be stored in the IN variable.
dataEnteringNode = IN


lst = []

def recursiveFib(v1,v2,count,lst):
	if count < 1:
		return lst
	
	nextValue = v1 + v2
	lst.append(nextValue)

	return recursiveFib(v2, nextValue, count -1, lst)

def interativeFib(v1,v2, count):
	lst = []
	lst.append(v1)
	lst.append(v2)
	
	for i in range(0, count):
		nextValue = lst[-1] + lst[-2]
		
		lst.append(nextValue)
	return lst

#Assign your output to the OUT variable
#OUT = recursiveFib(0,1,dataEnteringNode, [0,1])

OUT = interativeFib(0,1,10)
# ----------------------------------------
watch = Watch(fibonacci_sequence)
