# Dynamo custom node Fillet Square.dyf (Dynamo 0.7.0.23082)
# category: buildz
# Creates a list of Curves for a Filleted Square

width = Input()
formula = Formula("width/2", width=width, lacing=Longest)
radius = Input()
formula_2 = Formula("width-radius", width=formula, radius=radius, lacing=Longest)
formula_3 = Formula("-x", x=formula_2, lacing=Longest)
XYZ = Xyz(formula, formula_3, lacing=Longest)
origin = Input()
add_xyz = XyzAdd(XYZ, origin, lacing=Longest)
XYZ_2 = Xyz(formula, formula_2, lacing=Longest)
add_xyz_2 = XyzAdd(XYZ_2, origin, lacing=Longest)
line = LineBound(add_xyz, add_xyz_2, lacing=Longest)
XYZ_3 = Xyz(formula_2, formula_2, lacing=Longest)
add_xyz_3 = XyzAdd(XYZ_3, origin, lacing=Longest)
formula_4 = Formula("0", lacing=Longest)
formula_5 = Formula("Pi/2", lacing=Longest)
arc_by_ctr_pt = ArcCenter(add_xyz_3, radius, formula_4, formula_5, lacing=Longest)
list = NewList(index0=line, index1=arc_by_ctr_pt)
transform_curve = CurveTransformed(list, lacing=Longest)
z_axis = XyzBasisZ(lacing=Longest)
formula_6 = Formula("pi*.5", lacing=Longest)
formula_7 = Formula("pi*2", lacing=Longest)
number_range = NumberRange(formula_6, formula_7, formula_6, lacing=Longest)
rotate_transform = TransformRotation(origin, z_axis, number_range, lacing=Longest)
map = Map(transform_curve, rotate_transform)
flatten_completely = FlattenList(map)
curves = Output(flatten_completely)
