# Dynamo custom node Filter List By Booleans.dyf (Dynamo 0.6.3.35252)
# category: CAAD_RWTH.Lists
# Filters a list by a list of booleans and filters out those elements that correspond to a boolean False.

list = Input()
turn_into_list = Custom[Turn Into List](item=list)  # Turns an element into a (flat) list
booleans = Input()
turn_into_list_2 = Custom[Turn Into List](item=booleans)
list_2 = NewList(index0=turn_into_list, index1=turn_into_list_2)
equal_list_lengths = Custom[Equal List Lengths](lists=list_2)  # Trims all given lists to the length of the shortest list
python_script = Python(equal_list_lengths)
# ---------- python_script.python (19 lines) ----------
import clr
clr.AddReference('RevitAPI')
clr.AddReference('RevitAPIUI')
from Autodesk.Revit.DB import *
import Autodesk

inputlist = IN[0]
booleans = IN[1]
counter = 0
inlist = list()
outlist = list()
for item in inputlist:
	if booleans[counter] == 1:
		inlist.append(inputlist[counter])
	#else:
		#outlist.append(inputlist[counter])
	counter += 1
#OUT = (inlist,outlist)
OUT = inlist
# ----------------------------------------
list_3 = Output(python_script)  # "list"
