# Dynamo custom node Filter Selection by Family Type.dyf (Dynamo 0.6.3.13068)
# category: Revit.Families
# Filters a selection set (Select Elements) by Family Type (Select Family Type). Output "In" contains a list of all Instances of the Family Type. Output "Out" contains a list of all Instances that are not of the Family Type.

Selection = Input()
Family_Type = Input()
get_family_instances_by_type = GetFamilyInstancesByType(Family_Type)
get_name = Custom[Get Name](element_s=get_family_instances_by_type)  # Gets the name of a given Revit element (if possible)
list_contains = Custom[List Contains](list=get_name)  # Returns true if the given item is found in the given list, and false otherwise.
get_name_2 = Custom[Get Name](element_s=Selection)
map = Map(list_contains, get_name_2)
filter_by_boolean_mask = FilterMask(Selection, map)
In = Output(filter_by_boolean_mask.out0)
Out = Output(filter_by_boolean_mask.out1)
