# Dynamo custom node Flip Image Vertically.dyf (Dynamo 0.6.3.7993)
# category: CEE220C
# Takes Image, flips vertically.

List_image_to_Flip = Input()  # "List (image) to Flip"
Number_of_Elements_in_Each_Row = Input()
partition_list = Slice(List_image_to_Flip, Number_of_Elements_in_Each_Row)
reverse = Reverse(partition_list)
transpose_lists = Transpose(reverse)
reverse_2 = Reverse(transpose_lists)
flatten_completely = FlattenList(reverse_2)
List = Output(flatten_completely)
