# Dynamo custom node Flips Image Horizontally.dyf (Dynamo 0.6.3.7993)
# category: CEE220C
# Flips along the Y-Axis

List_image_to_Flip = Input()  # "List (image) to Flip"
Number_of_Elements_in_Each_Row = Input()
partition_list = Slice(List_image_to_Flip, Number_of_Elements_in_Each_Row)
reverse = Reverse(partition_list)
transpose_lists = Transpose(reverse)
reverse_2 = Reverse(transpose_lists)
flatten_completely = FlattenList(reverse_2)
reverse_3 = Reverse(flatten_completely)
partition_list_2 = Slice(reverse_3, Number_of_Elements_in_Each_Row)
transpose_lists_2 = Transpose(partition_list_2)
reverse_4 = Reverse(transpose_lists_2)
flatten_completely_2 = FlattenList(reverse_4)
partition_list_3 = Slice(flatten_completely_2, Number_of_Elements_in_Each_Row)
reverse_5 = Reverse(partition_list_3)
transpose_lists_3 = Transpose(reverse_5)
flatten_completely_3 = FlattenList(transpose_lists_3)
List = Output(flatten_completely_3)
