# Dynamo custom node Dragon Curve.dyf
# category: Fractals

order = Input()
XYZ = Xyz()
# note: Starting Direction
# note: Starting Accumulator
list = NewList(index0=XYZ)
# note: Starting Transform
identity_transform = TransformIdentity()
scale = Input()
# note: Length of line segments
formula = Formula("scale / Pow(Sqrt(2), order)", scale=scale, order=order)
XYZ_2 = Xyz(formula)
translate_transform = TransformTranslation(XYZ_2)
# note: Translation for "drawing" a line
number = DoubleInput(1)
dragon_loop = Custom[dragon loop](order=order, result=list, transform=identity_transform, translation=translate_transform, direction=number)
pts = Output(dragon_loop.pts)
