# Dynamo custom node Sierpinski arrowhead.dyf "Sierpiński Arrowhead"
# category: Fractals
# The Sierpiński arrowhead curve is a fractal curve similar in appearance and identical in limit to the Sierpiński triangle. This node generates XYZs for all endpoints in the curve.

order = Input()
scale = Input()
# note: Length of line segments
formula = Formula("scale / Pow(2, order)", scale=scale, order=order)
XYZ = Xyz(formula)
# note: Translation for "drawing" a line
translate_transform = TransformTranslation(XYZ)
# note: Starting Rotation
formula_2 = Formula("-pi/3")
XYZ_2 = Xyz()
# note: Starting Accumulator
list = NewList(index0=XYZ_2)
formula_3 = Formula("order%2==0", order=order)
identity_transform = TransformIdentity()
# note: Even: identity
# note: Odd: start at 60 degrees
formula_4 = Formula("pi/3")
rotate_z_origin = Custom[Rotate Z Origin](dn=formula_4)  # Creates a rotation transform around the z-axis at (0,0,0)
# note: Starting Transform
if_ = Conditional(formula_3, identity_transform, rotate_z_origin)
arrowhead_curve = Custom[arrowhead curve](order=order, translate=translate_transform, rotation=formula_2, result=list, transform=if_)  # internal recursive loop for sierpinski arrowhead
pts = Output(arrowhead_curve.pts)
