# Dynamo custom node arrowhead curve.dyf
# category: Fractals.Internal
# internal recursive loop for sierpinski arrowhead

order = Input()
number = DoubleInput(0)
equal = Equal(order, number)
transform = Input()
translate = Input()
multiply_transform = Multiplytransform(transform, translate)
# note: If the order is 0, apply the transform to (0, 0, 0) and place the result in the accumulator.
XYZ = XYZ()
transform_point = TransformPoint(multiply_transform, XYZ)
result = Input()
add_to_list = List(transform_point, result)
number_2 = DoubleInput(1)
# note: Order is decremented for recursive calls.
subtract = Subtraction(order, number_2)
# note: Rotation direction is flipped for first and third sub-sections.
number_3 = DoubleInput(-1)
rotation = Input()
multiply = Multiplication(number_3, rotation)
# note: First sub-section
arrowhead_curve = Custom[arrowhead curve](order=subtract, translate=translate, rotation=multiply, result=result, transform=transform)  # internal recursive loop for sierpinski arrowhead
rotate_z_origin = Custom[Rotate Z Origin](dn=rotation)  # Creates a rotation transform around the z-axis at (0,0,0)
# note: Rotate before starting second section
multiply_transform_2 = Multiplytransform(arrowhead_curve.transform, rotate_z_origin)
arrowhead_curve_2 = Custom[arrowhead curve](order=subtract, translate=translate, rotation=rotation, result=arrowhead_curve.pts, transform=multiply_transform_2)
# note: Second sub-section
# note: Third sub-section
# note: Rotate again before starting third section
# note: In the recursive calls, the "results" accumulator is passed along, and the "transform" accumulator is passed along after having a rotation applied.
multiply_transform_3 = Multiplytransform(arrowhead_curve_2.transform, rotate_z_origin)
# note: If the order is 0, update the transformation by applying the pre-calculated translation.
arrowhead_curve_3 = Custom[arrowhead curve](order=subtract, translate=translate, rotation=multiply, result=arrowhead_curve_2.pts, transform=multiply_transform_3)
if_ = Conditional(equal, add_to_list, arrowhead_curve_3.pts)
pts = Output(if_)
if_2 = Conditional(equal, multiply_transform, arrowhead_curve_3.transform)
transform_2 = Output(if_2)  # "transform"
