# Dynamo custom node dragon loop.dyf
# category: Fractals.Internal

order = Input()
number = DoubleInput(0)
equal = Equal(order, number)
transform = Input()
translation = Input()
multiply_transform = Multiplytransform(transform, translation)
# note: If the order is 0, apply the transform to (0, 0, 0) and place the result in the accumulator.
XYZ = XYZ()
transform_point = TransformPoint(multiply_transform, XYZ)
result = Input()
add_to_list = List(transform_point, result)
number_2 = DoubleInput(1)
# note: Order is decremented for recursive calls.
subtract = Subtraction(order, number_2)
direction = Input()
formula = Formula("dir * pi/4", dir=direction)
rotate_z_origin = Custom[Rotate Z Origin](dn=formula)  # Creates a rotation transform around the z-axis at (0,0,0)
multiply_transform_2 = Multiplytransform(transform, rotate_z_origin)
# note: First sub-section
number_3 = DoubleInput(1)
dragon_loop = Custom[dragon loop](order=subtract, result=result, transform=multiply_transform_2, translation=translation, direction=number_3)
# note: Rotate 45 degrees in current direction
# note: Rotate 90 degrees in opposite direction.
formula_2 = Formula("-dir * pi/2", dir=direction)
# note: Rotate before first section.
rotate_z_origin_2 = Custom[Rotate Z Origin](dn=formula_2)
# note: Rotate between sections
multiply_transform_3 = Multiplytransform(dragon_loop.transform, rotate_z_origin_2)
# note: Second sub-section
number_4 = DoubleInput(-1)
# note: If the order is 0, update the transformation by applying the pre-calculated translation.
dragon_loop_2 = Custom[dragon loop](order=subtract, result=dragon_loop.pts, transform=multiply_transform_3, translation=translation, direction=number_4)
if_ = Conditional(equal, add_to_list, dragon_loop_2.pts)
pts = Output(if_)
# note: Rotate after second section
multiply_transform_4 = Multiplytransform(dragon_loop_2.transform, rotate_z_origin)
if_2 = Conditional(equal, multiply_transform, multiply_transform_4)
transform_2 = Output(if_2)  # "transform"
