# Dynamo custom node Geometry Box.dyf (Dynamo 0.7.0.21202)
# category: buildz
# Creates a geometric box.  Needs a freeform element node to make a Revit Element

X = Input()
Y = Input()
Z = Input()
XYZ = Xyz(X, Y, Z, lacing=Longest)
translate_transform = TransformTranslation(XYZ, lacing=Longest)
xyz_zero = XyzZero(lacing=Longest)
z_axis = XyzBasisZ(lacing=Longest)
Rotation_Radians = Input()  # "Rotation(Radians)"
rotate_transform = TransformRotation(xyz_zero, z_axis, Rotation_Radians, lacing=Longest)
multiply_transform = Multiplytransform(translate_transform, rotate_transform, lacing=Longest)
Width = Input()
Length = Input()
rectangle = Rectangle(multiply_transform, Width, Length, lacing=Longest)
list = NewList(index0=rectangle)
z_axis_2 = XyzBasisZ(lacing=Longest)
Height = Input()
create_extrusion_geometry = CreateExtrusionGeometry(list, z_axis_2, Height, lacing=Longest)
