# Dynamo custom node Geometry Sphere.dyf (Dynamo 0.7.0.21202)
# category: buildz
# geometry sphere

Radius = Input()
formula = Formula("-x", x=Radius, lacing=Longest)
XYZ = Xyz(arg2=formula, lacing=Longest)
X = Input()
Y = Input()
Z = Input()
XYZ_2 = Xyz(X, Y, Z, lacing=Longest)
add_xyz = XyzAdd(XYZ, XYZ_2, lacing=Longest)
XYZ_3 = Xyz(arg2=Radius, lacing=Longest)
add_xyz_2 = XyzAdd(XYZ_3, XYZ_2, lacing=Longest)
line = LineBound(add_xyz, add_xyz_2, lacing=Longest)
XYZ_4 = Xyz(Radius, lacing=Longest)
add_xyz_3 = XyzAdd(XYZ_4, XYZ_2, lacing=Longest)
arc_by_start_mid_end = ArcStartMiddleEnd(add_xyz_2, add_xyz_3, add_xyz, lacing=Longest)
list = NewList(index0=line, index1=arc_by_start_mid_end)
curve_loop = CurveLoop(list, lacing=Longest)
z_axis = XyzBasisZ(lacing=Longest)
y_axis = XyzBasisY(lacing=Longest)
transf_from_origin_and_vecs = TransformOriginAndVectors(add_xyz, z_axis, y_axis, lacing=Longest)
number = DoubleInput(0)
angle_deg = AngleInput(360)
create_revolved_geometry = CreateRevolvedGeometry(curve_loop, transf_from_origin_and_vecs, number, angle_deg, lacing=Longest)
