# Dynamo custom node Get Bounding Box.dyf (Dynamo 0.6.3.22045)
# category: CAAD_RWTH.Revit
# Gets the bounding box of a Revit element

Element_s = Input()  # "Element(s)"
turn_into_list = Custom[Turn Into List](item=Element_s)  # Turns an element into a (flat) list
get_active_view = ActiveRevitView(lacing=Longest)
python_script_with_variable = Python(turn_into_list, get_active_view)  # "Python Script With Variable Number of Inputs"
# ---------- python_script_with_variable.python (20 lines) ----------
import clr
clr.AddReference('RevitAPI')
clr.AddReference('RevitAPIUI')
from Autodesk.Revit.DB import *
import Autodesk

items = IN0
view = IN1
elementlist = list()
maxlist = list()
minlist = list()

for item in items:
	try:
		elementlist.append(item.BoundingBox[view])
		maxlist.append(item.BoundingBox[view].Max)
		minlist.append(item.BoundingBox[view].Min)
	except:
		donothing = 1
OUT = (elementlist,maxlist,minlist)
# ----------------------------------------
first_of_list = First(python_script_with_variable)
bbox = Output(first_of_list)
number = DoubleInput(1)
get_from_list = GetFromList(number, python_script_with_variable)
bottom_left_rear_corner = Output(get_from_list)
number_2 = DoubleInput(2)
get_from_list_2 = GetFromList(number_2, python_script_with_variable)
top_right_front_corner = Output(get_from_list_2)
