# Dynamo custom node Get Closest N points.dyf (Dynamo 0.6.3.5258)
# category: buildz
# Find the closes set of points in 2 lists

Number_of_Points = Input()
formula = Formula("x-1", x=Number_of_Points, lacing=Longest)
number = DoubleInput(0..x, formula, lacing=Longest)
get_from_list = GetFromList(number)
Target_List = Input()
sort_nearest_xyz = Custom[Sort Nearest XYZ](target_list=Target_List)  # Sort XYZ by proximity to another point
Start_List = Input()
map = Map(sort_nearest_xyz, Start_List)
map_2 = Map(get_from_list, map)
mapped = Output(map_2)
