# Dynamo custom node Sort Nearest XYZ.dyf (Dynamo 0.6.3.5258)
# category: buildz
# Sort XYZ by proximity to another point

start_list = Input()
xyz_distance = XyzDistance(start_list, lacing=Longest)
target_list = Input()
sort_by_key = SortBy(xyz_distance, target_list)
sorted = Output(sort_by_key)
