# Dynamo custom node Get Family Instances from Revit link.dyf (Dynamo 0.6.3.38253)
# category: JBE
# Selects in a linked file the instances of a given category

number = DoubleInput(0)
Choosen_Link_Index = Input()
List_of_Linked_Doct = Input()
get_from_list = GetFromList(Choosen_Link_Index, List_of_Linked_Doct)
OST_Category = Input()
Link_Instances = Input()
python_script_with_variable = Python(get_from_list, OST_Category, Link_Instances)  # "Python Script With Variable Number of Inputs"
# ---------- python_script_with_variable.python (36 lines) ----------
#WIP code from Julien BENOIT
#@Jbenoit44
#www.http://aecuandme.wordpress.com/
# Default imports
import clr
clr.AddReference('RevitAPI')
clr.AddReference('RevitAPIUI')
from Autodesk.Revit.DB import *
import Autodesk
import sys
import clr
path = r'C:\Autodesk\Dynamo\Core'
exec_path = r'C:\Autodesk\Dynamo\Core\dll'
sys.path.append(path)
sys.path.append(exec_path)
clr.AddReference('LibGNet')
from Autodesk.LibG import *
clr.AddReference('DynamoPython')
clr.AddReference('Dynamocore')
clr.AddReference("DynamoUtilities")
clr.AddReference("DynamoRevit")
import Dynamo

doc = IN0
cat = IN1
items = IN2
elementlist = []
T = []
#get elements of a given category, then gives the transform from origin(XYZ)
for item in items:
	collector = FilteredElementCollector(doc)
	filter = ElementCategoryFilter(cat)
	elementlist.append(collector.WherePasses(filter).WhereElementIsNotElementType().ToElements())
	a = item.GetTransform().Origin
	T.append(a)
OUT = elementlist,T
# ----------------------------------------
get_from_list_2 = GetFromList(number, python_script_with_variable)
list = Output(get_from_list_2)
number_2 = DoubleInput(1)
get_from_list_3 = GetFromList(number_2, python_script_with_variable)
Link_Instance_Origin = Output(get_from_list_3)
