# Dynamo custom node Get Host ID for Analytical member.dyf (Dynamo 0.6.3.20252)
# category: JBE
# Get ID of analytical model host

element_s = Input()  # "element(s)"
python_script = Python(element_s)
# ---------- python_script.python (14 lines) ----------
import clr
clr.AddReference('RevitAPI')
clr.AddReference('RevitAPIUI')
from Autodesk.Revit.DB import *
import Autodesk
#@jbenoit44
analytics = IN
hostid = list()
for item in analytics:
	try:
		hostid.append(item.GetElementId())
	except:
		hostid.append(list())
OUT = hostid
# ----------------------------------------
ID = Output(python_script)
