# Dynamo custom node Get Linked Documents.dyf (Dynamo 0.6.3.38253)
# category: JBE
# Gives Revit Links, file names and position information

number = DoubleInput(0)
revit_document = RevitDocument(lacing=Longest)
python_get_the_documents = Python(revit_document)
# ---------- python_get_the_documents.python (44 lines) ----------
#WIP code from Julien BENOIT
#@Jbenoit44
#www.http://aecuandme.wordpress.com/

# Default imports
import clr
clr.AddReference('RevitAPI')
clr.AddReference('RevitAPIUI')
from Autodesk.Revit.DB import *
import Autodesk
import sys
import clr
path = r'C:\Autodesk\Dynamo\Core'
exec_path = r'C:\Autodesk\Dynamo\Core\dll'
sys.path.append(path)
sys.path.append(exec_path)
clr.AddReference('LibGNet')
from Autodesk.LibG import *
clr.AddReference('DynamoPython')
clr.AddReference('Dynamocore')
clr.AddReference("DynamoUtilities")
clr.AddReference("DynamoRevit")
import Dynamo

rvt = IN
link=[]
name=[]
linkinst=[]

#get a document set
x = Dynamo.Utilities.dynRevitSettings.Revit.Application.Documents

#test if document is a link, returns doc and doc name in 2 separate lists
for doc in x:
	if doc.IsLinked:
		link.append(doc)
		name.append(doc.Title)
			
#looks for links in the active project, add instances to a list
collector = FilteredElementCollector(rvt)
filter = ElementCategoryFilter(BuiltInCategory.OST_RvtLinks)
linkinst.append(collector.WherePasses(filter).WhereElementIsNotElementType().ToElements())
	
OUT = (link,name,linkinst)
# ----------------------------------------
get_from_list = GetFromList(number, python_get_the_documents)
Linked_Revit_Doct = Output(get_from_list)
number_2 = DoubleInput(1)
get_from_list_2 = GetFromList(number_2, python_get_the_documents)
Link_s_name_s = Output(get_from_list_2)  # "Link(s) name(s)"
number_3 = DoubleInput(2)
get_from_list_3 = GetFromList(number_3, python_get_the_documents)
flatten_completely = FlattenList(get_from_list_3)
Link_s_Instances = Output(flatten_completely)  # "Link(s) Instances"
