# Dynamo custom node Get Result List Column Values.dyf (Dynamo 0.6.3.7993)
# category: CEE120.Session11
# Gets the list of result values in a column of a hierarchical list

columnToGet = Input()
get_from_list = GetFromList(columnToGet)
heirarchicalList = Input()
map = Map(get_from_list, heirarchicalList)
