# Dynamo custom node Get Rooms by Level.dyf (Dynamo 0.6.3.7993)
# category: Revit.API
# Filters Rooms by level.

number = DoubleInput(1)
Level = Input()
ExcludeUnplaced = Input()  # "ExcludeUnplaced?"
python_script_with_variable = Python(Level, ExcludeUnplaced)  # "Python Script With Variable Number of Inputs"
# ---------- python_script_with_variable.python (41 lines) ----------
# Default imports
import clr
clr.AddReference('RevitAPI')
clr.AddReference('RevitAPIUI')
from Autodesk.Revit.DB import *
import Autodesk
import sys
import clr
path = r'C:\Autodesk\Dynamo\Core'
exec_path = r'C:\Autodesk\Dynamo\Core\dll'
sys.path.append(path)
sys.path.append(exec_path)
clr.AddReference('LibGNet')
from Autodesk.LibG import *

#The input to this node will be stored in the IN variable.
dataEnteringNode = IN0
level_input = IN0
filterToggle = IN1
roomNames = []
validRooms = []

doc = __doc__

level_filter = ElementLevelFilter(level_input.Id)
collector = FilteredElementCollector(doc)


if filterToggle == 0:
	all_rooms_on_level = collector.OfClass(Autodesk.Revit.DB.SpatialElement).WherePasses(level_filter).ToElements()
	for i in all_rooms_on_level:
		roomNames.append(i.get_Parameter("Name").AsString())
	OUT = all_rooms_on_level, roomNames
else:
	all_rooms_on_level = collector.OfClass(Autodesk.Revit.DB.SpatialElement).WherePasses(level_filter).ToElements()
	for i in all_rooms_on_level:
		if i.Area !=0:
			validRooms.append(i)
	for i in validRooms:
		roomNames.append(i.get_Parameter("Name").AsString())
	OUT = validRooms, roomNames
# ----------------------------------------
get_from_list = GetFromList(number, python_script_with_variable)
Room_Names = Output(get_from_list)
number_2 = DoubleInput(0)
get_from_list_2 = GetFromList(number_2, python_script_with_variable)
Rooms = Output(get_from_list_2)
