# Dynamo custom node Get Sun Directness for Face.dyf (Dynamo 0.6.2.29585)
# category: CEE220C

UV_Grid_Number = Input()
Face = Input()
get_surface_domain = SurfaceDomain(Face, lacing=Longest)
uv_grid = UvGrid(get_surface_domain, UV_Grid_Number, UV_Grid_Number)
evaluate_surface = XyzEvaluate(uv_grid, Face, lacing=Longest)
quads_from_rectangular_grid = Custom[Quads from Rectangular Grid](Row_Number=UV_Grid_Number, Point_List=evaluate_surface)  # Given a grid of points (xyz or uv) create a list of quadrilaterals
SunPath = Input()
evaluate_sun_directness_raw = Custom[Evaluate Sun Directness - Raw Distances](Quads=quads_from_rectangular_grid, SunPath=SunPath)  # Returns values from 0 to 1 based on orientation relative to sun path
average = Average(evaluate_sun_directness_raw.rawDistanceValues, lacing=Longest)
Average_Sun_Directness_on_Face = Output(average)
