# Dynamo custom node GetWorksets.dyf (Dynamo 0.6.3.5244)
# category: Revit.Document
# Query an active project for all User Worksets and their ID's.

number = DoubleInput(0)
empty_list = Empty()
all_user_worksets_names_and_id_s = Python(empty_list)
# ---------- all_user_worksets_names_and_id_s.python (25 lines) ----------
# Default imports
import clr
clr.AddReference('RevitAPI')
clr.AddReference('RevitAPIUI')
from Autodesk.Revit.DB import *
import Autodesk
import sys
import clr
path = r'C:\Autodesk\Dynamo\Core'
exec_path = r'C:\Autodesk\Dynamo\Core\dll'
sys.path.append(path)
sys.path.append(exec_path)
clr.AddReference('LibGNet')
from Autodesk.LibG import *

#The input to this node will be stored in the IN variable.
dataEnteringNode = IN
doc = __doc__

collector = FilteredWorksetCollector(doc)
user_worksets = collector.OfKind(WorksetKind.UserWorkset)


#Assign your output to the OUT variable
OUT = [[i.Name for i in user_worksets], [i.Id for i in user_worksets]]
# ----------------------------------------
get_from_list = GetFromList(number, all_user_worksets_names_and_id_s)
Names = Output(get_from_list)
number_2 = DoubleInput(1)
get_from_list_2 = GetFromList(number_2, all_user_worksets_names_and_id_s)
IDs = Output(get_from_list_2)
