# Dynamo custom node Grid from Sun.dyf (Dynamo 0.6.3.25646)
# category: Analyze.Solar

# note: Create a square grid of points at the position of the sun given a vector. Grid rows are aligned to the global XY plane.
sun_vector = Input()
XYZ = Xyz(lacing=Longest)
unitize_xyz = XyzNormalize(sun_vector, lacing=Longest)
number = DoubleInput(0)
z_axis = XyzBasisZ(lacing=Longest)
xyz_cross_product = XyzCrossProduct(unitize_xyz, z_axis, lacing=Longest)
unitize_xyz_2 = XyzNormalize(xyz_cross_product, lacing=Longest)
# note: Origin
xyz_dot_product = XyzDotProduct(unitize_xyz, z_axis, lacing=Longest)
formula = Formula("-Acos(dotProd)", dotProd=xyz_dot_product, lacing=Longest)
rotate_transform = TransformRotation(XYZ, unitize_xyz_2, formula, lacing=Longest)
transform_xyz = TransformPoint(rotate_transform, lacing=Longest)
grid_count = Input()
number_2 = DoubleInput(1)
grid_spacing = Input()
formula_2 = Formula("-(count-1)*space/2", count=grid_count, space=grid_spacing, lacing=Longest)
# note: Grid
number_3 = DoubleInput(0)
# note: x-vector of new reference frame
xyz_grid = ReferencePtGrid(grid_count, grid_count, number_2, formula_2, formula_2, number_3, grid_spacing, grid_spacing, number_3, lacing=Longest)
# note: Grid transformed to be
# perpendicular to sun vector
map = Map(transform_xyz, xyz_grid)
get_from_list = GetFromList(number, map)
negate_xyz = XyzNegate(get_from_list, lacing=Longest)
number_4 = DoubleInput(1)
get_from_list_2 = GetFromList(number_4, map)
# note: "x-vector" of first transform
# to correct to be parallel to x/y plane
add_xyzs = XyzAdd(negate_xyz, get_from_list_2, lacing=Longest)
unitize_xyz_3 = XyzNormalize(add_xyzs, lacing=Longest)
xyz_dot_product_2 = XyzDotProduct(unitize_xyz_3, unitize_xyz_2, lacing=Longest)
formula_3 = Formula("acos(dotProd)", dotProd=xyz_dot_product_2, lacing=Longest)
rotate_transform_2 = TransformRotation(XYZ, unitize_xyz, formula_3, lacing=Longest)
transform_xyz_2 = TransformPoint(rotate_transform_2, lacing=Longest)
# note: Grid rotated to have x-direction
# parallel with global x/y plane
map_2 = Map(transform_xyz_2, map)
# note: Grid at position of sun vector
add_xyzs_2 = XyzAdd(sun_vector, map_2, lacing=Longest)
grid = Output(add_xyzs_2)
