# Dynamo custom node Highlight Elements in view.dyf (Dynamo 0.6.3.7993)
# category: JBE
# Highlight the choosen elements in view

Elements = Input()
turn_into_list = Custom[Turn Into List](item=Elements)  # Turns an element into a (flat) list
python_script = Python(turn_into_list)
# ---------- python_script.python (26 lines) ----------
# Default imports
import clr
clr.AddReference('RevitAPI')
clr.AddReference('RevitAPIUI')
from Autodesk.Revit.DB import *
import Autodesk
import sys
import clr
path = r'C:\Autodesk\Dynamo\Core'
exec_path = r'C:\Autodesk\Dynamo\Core\dll'
sys.path.append(path)
sys.path.append(exec_path)
clr.AddReference('LibGNet')
from Autodesk.LibG import *


uidoc = __revit__.ActiveUIDocument

b=[]

elements = IN
for item in elements:
	uidoc.Selection.Elements.Add(item)
	b.append(item.Id)

OUT = b
# ----------------------------------------
IDs = Output(python_script)
