# Dynamo custom node If Equal Return Index.dyf (Dynamo 0.6.2.29585)
# category: Core.Lists.Query
# If element in list A is equal to an element in list B then return index from list B.

listA = Input()
listB = Input()
list = NewList(index0=listA, index1=listB)
python_if_equal_return_index = Python(list)
# ---------- python_if_equal_return_index.python (10 lines) ----------
listaA = IN[0]
listaB = IN[1]
indiceslist = list()
for lA in listaA:
	counter = 0
	for lB in listaB:
		if (lA == lB):
			indiceslist.append(counter)
		counter += 1
OUT = indiceslist
# ----------------------------------------
Index = Output(python_if_equal_return_index)
