# Dynamo custom node If Null Replace With New Value.dyf (Dynamo 0.6.3.31052)
# category: buildz
# replaces a null with a specified value.  Use with Map for lists

item = Input()
is_null = IsNull(item)
newValue = Input()
if_ = Conditional(is_null, newValue, item)
cleaned = Output(if_)
