# Dynamo custom node Inscribed Polygon.dyf
# category: Create Geometry.Curve
# Create polygon geometry inscribed inside a circle in the massing environment.

center = Input()
rad = Input()
circle = Circle(center, rad, lacing=Longest)
sides = Input()
formula = Formula("if(S<3,3,S)", S=sides, lacing=Longest)
floor = Floor(formula, lacing=Longest)
formula_2 = Formula("s+1", s=floor, lacing=Longest)
xyz_array_on_curve = XyzArrayAlongCurve(circle, formula_2, lacing=Longest)
lines_through_xyz = CurvesThroughPoints(xyz_array_on_curve, lacing=Longest)
curve_loop = CurveLoop(lines_through_xyz, lacing=Longest)
