# Dynamo custom node Insert Char in String.dyf (Dynamo 0.6.3.35252)
# category: Core.Strings
# Insert characters in a string by specifying a numeric position from the string start

string = Input()
number = DoubleInput(0)
of_char = Input()  # "# of char"
substring = Substring(string, number, of_char)
add_char = Input()
string_length = StringLen(string)
formula = Formula("X-Y", X=string_length, Y=of_char, lacing=Longest)
substring_2 = Substring(string, of_char, formula)
concat_strings = ConcatStrings(s3=substring, add_char, substring_2)
string_2 = Output(concat_strings)  # "string"
