# Dynamo custom node Insert Char(s) in List of Strings.dyf (Dynamo 0.6.3.35252)
# category: Core.Strings
# Insert character(s) in a list of strings by specifying a numeric position from the string start

list = Input()
list_length = Length(list)
is_empty_list = IsEmpty(list)
empty_list = Empty()
first_of_list = First(list)
of_char = Input()  # "# of char"
add_char_s = Input()  # "add char(s)"
insert_char_in_string = Custom[Insert Char in String](string=first_of_list, of_char=of_char, add_char=add_char_s)  # Insert characters in a string by specifying a numeric position from the string start
rest_of_list = Rest(list)
insert_char_s_in_list_of_strings = Custom[Insert Char(s) in List of Strings](list=rest_of_list, of_char=of_char, add_char_s=add_char_s)  # Insert character(s) in a list of strings by specifying a numeric position from the string start
add_to_list = List(insert_char_in_string, insert_char_s_in_list_of_strings)
if_ = Conditional(is_empty_list, empty_list, add_to_list)
list_2 = Output(if_)  # "list"
