# Dynamo custom node Interference Report Parser.dyf (Dynamo 0.6.3.7993)
# category: Archi-lab.Warnings
# Parses an HTML report from Interference check. It outputs a list of IDs of elements that created clashes. Uses BeautifulSoup and re (regular expression) to parse the html file so please verify that those modules are installed and proper paths are appended.

number = DoubleInput(1)
File_Path = Input()
python_script_with_variable = Python(File_Path)  # "Python Script With Variable Number of Inputs"
# ---------- python_script_with_variable.python (48 lines) ----------
# Default imports
import clr
clr.AddReference('RevitAPI')
clr.AddReference('RevitAPIUI')
from Autodesk.Revit.DB import *
import Autodesk
import sys
import clr
path = r'C:\Autodesk\Dynamo\Core'
exec_path = r'C:\Autodesk\Dynamo\Core\dll'
lib_path = r'C:\Program Files (x86)\IronPython 2.7\Lib\BeautifulSoup-3.2.1'
pyt_path = r'C:\Program Files (x86)\IronPython 2.7\Lib'
sys.path.append(path)
sys.path.append(exec_path)
sys.path.append(lib_path)
sys.path.append(pyt_path)
clr.AddReference('LibGNet')
from Autodesk.LibG import *
from BeautifulSoup import BeautifulSoup
import re

#The input to this node will be stored in the IN0...INX variable(s).
dataEnteringNode = IN0
#open html file and get contents
url = str(IN0)
with open(url, 'r') as f:
    data = f.read()
    
txt = []
#crate a beautifulsoup object
soup = BeautifulSoup(data)
tag = soup.findAll('tr')
#convert beautifulsoup object into string
for i in tag:
	txt.append(str(i.text))
#remove first item from list
txt.remove("AB")
#get total number of warnings
total_warnings = len(txt)
#parse the properties cell for element IDs	
pattern = re.compile(r"\bid\s*?(\d+)")
ids = ["; ".join(pattern.findall(item)) for item in txt]
#create a list of individual ids
final_ids = list(ids)
str_ids = ' ;'.join(str(elem) for elem in final_ids)
list_ids = set(str_ids.replace(" ", "").split(";"))
#define outputs
OUT = list_ids, total_warnings
# ----------------------------------------
get_from_list = GetFromList(number, python_script_with_variable)
Total_Number_of_Clashes = Output(get_from_list)
number_2 = DoubleInput(0)
get_from_list_2 = GetFromList(number_2, python_script_with_variable)
ID_s = Output(get_from_list_2)  # "ID(s)"
