# Dynamo custom node Is Odd Number.dyf (Dynamo 0.6.3.5256)
# category: CAAD_RWTH.Math
# Checks if a number is odd.

val = Input()
formula = Formula("Round(n,0)/2!=Round(Round(n,0)/2,0)", n=val, lacing=Longest)
bool = Output(formula)
