# Dynamo custom node Isolate in View.dyf (Dynamo 0.6.3.5244)
# category: Archi-lab.Visibility
# Temporarily isolates specified elements in a current view.

Active_View = Input()
ID_s = Input()  # "ID(s)"
empty_list = Empty()
add_to_list = List(ID_s, empty_list)
flatten_completely = FlattenList(add_to_list)
python_script_with_variable = Python(Active_View, flatten_completely)  # "Python Script With Variable Number of Inputs"
# ---------- python_script_with_variable.python (52 lines) ----------
# Default imports
import clr
clr.AddReference('RevitAPI')
clr.AddReference('RevitAPIUI')
from Autodesk.Revit.DB import *
import Autodesk
import sys
import clr
path = r'C:\Autodesk\Dynamo\Core'
exec_path = r'C:\Autodesk\Dynamo\Core\dll'
sys.path.append(path)
sys.path.append(exec_path)
clr.AddReference('LibGNet')
from Autodesk.LibG import *
from System.Collections.Generic import *
#The input to this node will be stored in the IN variable.
dataEnteringNode = IN0
view = IN0
str_ids = IN1
doc = __doc__

#get all elements in an active view
collector = FilteredElementCollector(doc, view.Id)

#create an element set from input string ids
element_set = ElementSet()
for i in str_ids:
	if isinstance(i, str):
		int_id = int(i)
		id = ElementId(int_id)
		element = doc.GetElement(id)
		element_set.Insert(element)
	else:
		element = doc.GetElement(i)
		element_set.Insert(element)
#create a set of element ids from element set
excludes = List[ElementId]()
elemIter = element_set.ForwardIterator()
elemIter.Reset()
while elemIter.MoveNext():
	curElem = elemIter.Current
	excludes.Add(curElem.Id)
#create exclusion filter containing input ids
filter = ExclusionFilter(excludes)
#create a collector that will select all elements in a view except one matching input element ids
new_collector = FilteredElementCollector(doc, view.Id).WhereElementIsNotElementType().WherePasses(filter).ToElementIds()
#hide elements in a view
view.HideElementsTemporary(new_collector)
#get active view name
view_name = view.ViewName
#Assign your output to the OUT variable
OUT = view_name
# ----------------------------------------
Current_View_Name = Output(python_script_with_variable)
