# Dynamo custom node Last of List.dyf (Dynamo 0.7.0.26505)
# category: Core.Lists
# Gets the last element of a list.

list = Input()
rest_of_list = Rest(list)
is_empty_list = IsEmpty(rest_of_list)
first_of_list = First(list)
last_of_list = Custom[Last of List](list=rest_of_list)  # Gets the last element of a list.
if_ = Conditional(is_empty_list, first_of_list, last_of_list)
last = Output(if_)
