# Dynamo custom node Last of String.dyf (Dynamo 0.6.3.35252)
# category: Core.Strings
# Substring after dropping the first "X" characters

string = Input()
of_char = Input()  # "# of char"
string_length = StringLen(string)
formula = Formula("X-Y", X=string_length, Y=of_char, lacing=Longest)
substring = Substring(string, of_char, formula)
sub = Output(substring)
