# Dynamo custom node List BuiltInParameterGroup.dyf (Dynamo 0.6.3.7993)
# category: JBE
# List BuiltInParameterGroup for ex: PG_AREA

empty_list = Empty()
python_script = Python(empty_list)
# ---------- python_script.python (7 lines) ----------
import clr
clr.AddReference('RevitAPI')
clr.AddReference('RevitAPIUI')
from Autodesk.Revit.DB import *
import Autodesk

OUT = dir(BuiltInParameterGroup)
# ----------------------------------------
string = StringInput("PG_*")
match_regular_expression = Custom[Match Regular Expression](regex=string, string_s=python_script)  # Determines if a regular expression matches a string (or a list of strings) and returns a boolean value (or a list, depending on the input). The syntax for regular expressions is explained at http://ironpython-test.readthedocs.org/en/latest/howto/regex.html
filter_by_boolean_mask = FilterMask(python_script, match_regular_expression)
List = Output(filter_by_boolean_mask)
