# Dynamo custom node Exists in List.dyf "List Contains"
# category: Core.Lists
# Returns true if the given item is found in the given list, and false otherwise.

item = Input()
equal = Equal(item)
list = Input()
true_for_any = OrMap(equal, list)
exists = Output(true_for_any)  # "exists?"
