# Dynamo custom node List Intersection.dyf (Dynamo 0.6.3.7993)
# category: JBE
# returns elements that are in both lists

ListA = Input()
ListB = Input()
list_intersection = Python(ListA, ListB)
# ---------- list_intersection.python (21 lines) ----------
# Default imports
import clr
clr.AddReference('RevitAPI')
clr.AddReference('RevitAPIUI')
from Autodesk.Revit.DB import *
import Autodesk
import sys
import clr
path = r'C:\Autodesk\Dynamo\Core'
exec_path = r'C:\Autodesk\Dynamo\Core\dll'
sys.path.append(path)
sys.path.append(exec_path)
clr.AddReference('LibGNet')
from Autodesk.LibG import *

listA = IN0
listB = IN1
b=[]
a=list(set(listA).intersection(set(listB)))
b.append(a)
OUT = a
# ----------------------------------------
list = Output(list_intersection)
