# Dynamo custom node List ParameterType.dyf (Dynamo 0.6.3.7993)
# category: CAAD_RWTH.Scripting
# List all the BuiltInCategories available

empty_list = Empty()
python_script = Python(empty_list)
# ---------- python_script.python (7 lines) ----------
import clr
clr.AddReference('RevitAPI')
clr.AddReference('RevitAPIUI')
from Autodesk.Revit.DB import *
import Autodesk

OUT = dir(ParameterType)
# ----------------------------------------
list = Output(python_script)
