# Dynamo custom node List Range Converter.dyf (Dynamo 0.6.2.29585)
# category: buildz
# Takes a List lenth and allows a slider indexing

x = Input()
list = Input()
list_length = Length(list)
formula = Formula("Round((x*(listLength-1)),0)", x=x, listLength=list_length, lacing=Longest)
Output = Output(formula)  # ""
