# Dynamo custom node Insert Into List.dyf (Dynamo 0.6.2.31398)
# category: Core.Lists
# Inserts an element into a list at a given index.

number = DoubleInput(0)
index = Input()
equal = Equal(number, index)
item = Input()
is_empty_list = IsEmpty(item)
empty_list = Empty()
list = Input()
split_list = DeCons(list)
formula = Formula("x-1", x=index, lacing=Longest)
insert_into_list = Custom[Insert Into List](item=item, list=split_list.out1, index=formula)  # Inserts an element into a list at a given index.
add_to_list = List(split_list.out0, insert_into_list)
if_ = Conditional(is_empty_list, empty_list, add_to_list)
add_to_list_2 = List(item, if_)
if_2 = Conditional(equal, add_to_list_2, if_)
Output = Output(if_2)  # ""
