# Dynamo custom node Replace Item In List.dyf (Dynamo 0.6.2.31398)
# category: Core.Lists
# Inserts an item into a list at a specific index, replacing the item that was already at that index.

list = Input()
is_empty_list = IsEmpty(list)
empty_list = Empty()
index = Input()
formula = Formula("x==0", x=index, lacing=Longest)
item = Input()
split_list = DeCons(list)
add_to_list = List(item, split_list.out1)
formula_2 = Formula("x-1", x=index, lacing=Longest)
replace_item_at_list_index = Custom[Replace Item At List Index](item=item, list=split_list.out1, index=formula_2)  # Inserts an item into a list at a specific index, replacing the item that was already at that index.
add_to_list_2 = List(split_list.out0, replace_item_at_list_index)
# note: This should really be an error...
if_ = Conditional(formula, add_to_list, add_to_list_2)
if_2 = Conditional(is_empty_list, empty_list, if_)
Output = Output(if_2)  # ""
