# Dynamo custom node LunchBox Adaptive Component Collector.dyf (Dynamo 0.6.3.38253)
# category: LunchBox.Revit.Elements
# Gets a list of Adaptive Components from a document using the Family Name.

number = DoubleInput(0)
FamilyType = Input()
python_script = Python(FamilyType)
# ---------- python_script.python (63 lines) ----------
#Copyright(c) 2014, Nathan Miller
# The Proving Ground, http://theprovingground.org
# Default imports

import clr
clr.AddReference('RevitAPI')
clr.AddReference('RevitAPIUI')
from Autodesk.Revit.DB import *
import Autodesk
import sys
import clr
path = r'C:\Autodesk\Dynamo\Core'
exec_path = r'C:\Autodesk\Dynamo\Core\dll'
sys.path.append(path)
sys.path.append(exec_path)
clr.AddReference('LibGNet')
from Autodesk.LibG import *

doc = __doc__

familytype = IN

collector = FilteredElementCollector(doc)
#collector.OfCategory(BuiltInCategory.OST_CurtainWallPanels)
collector.OfClass(FamilyInstance)
 
famtypeitr = collector.GetElementIdIterator()
famtypeitr.Reset()

output = []
inst = []
location = []
adpts = []
elementids = []
uniqueids = []
for item in famtypeitr:
    famtypeID = item
    faminst = doc.GetElement(famtypeID)
    #print faminst
 
    if faminst.Symbol.Id == familytype.Id:
    	adptPoints = AdaptiveComponentInstanceUtils.GetInstancePlacementPointElementRefIds(faminst)
    	pts = []
    	for i in range(0, len(adptPoints)):
    		apt = doc.GetElement(adptPoints[i])
    		cs = apt.GetCoordinateSystem()
    		pts.append(cs.Origin)

    	adpts.append(pts)

    	loc = faminst.Location.Point
        inst.append(faminst)
        location.append(loc)
        elementids.append(faminst.Id)
        uniqueids.append(faminst.UniqueId)
        
output.append(inst)
output.append(adpts)
output.append(elementids)
output.append(uniqueids)

#Assign your output to the OUT variable
OUT = output
# ----------------------------------------
get_from_list = GetFromList(number, python_script)
AC = Output(get_from_list)
number_2 = DoubleInput(1)
get_from_list_2 = GetFromList(number_2, python_script)
Points = Output(get_from_list_2)
number_3 = DoubleInput(2)
get_from_list_3 = GetFromList(number_3, python_script)
Element_ID = Output(get_from_list_3)
number_4 = DoubleInput(3)
get_from_list_4 = GetFromList(number_4, python_script)
Unique_ID = Output(get_from_list_4)
