# Dynamo custom node LunchBox Attractor Wave.dyf (Dynamo 0.6.2.2709)
# category: LunchBox.Generate
# Generates a wave attractor effect using lists of attractors and targets.

Attractors = Input()
Targets = Input()
Frequency = Input()
list = NewList(index0=Attractors, index1=Targets, index2=Frequency)
python_script = Python(list)
# ---------- python_script.python (44 lines) ----------
#Copyright(c) 2014, Nathan Miller
# The Proving Ground, http://theprovingground.org
# Default imports
import clr
clr.AddReference('RevitAPI')
clr.AddReference('RevitAPIUI')
from Autodesk.Revit.DB import *
import Autodesk
import sys
import clr
path = r'C:\Autodesk\Dynamo\Core'
exec_path = r'C:\Autodesk\Dynamo\Core\dll'
sys.path.append(path)
sys.path.append(exec_path)
clr.AddReference('LibGNet')
from Autodesk.LibG import *
import math

#The input to this node will be stored in the IN variable.
list = IN[0]
tar = IN[1]
t = IN[2]

distList = []

att = []
if hasattr(list, "__iter__"):
    for i in range(0,len(list)):
		att.append(list[i])
else:
    att.append(list)

for i in range(0,len(tar)):
	myTarget = tar[i]
	distance = 0
	vector = XYZ(0,0,0)
	for j in range(0,len(att)):
		distance = distance + (10 * math.sin(att[j].DistanceTo(myTarget) * t))
	avg = distance/len(att)
	distList.append(avg)


#Assign your output to the OUT variable
OUT = distList
# ----------------------------------------
Domain = Input()
lunchbox_remap_numbers = Custom[LunchBox Remap Numbers](Numbers=python_script, Domain=Domain)  # Remaps a list of numbers to a new domain.
Values = Output(lunchbox_remap_numbers)
