# Dynamo custom node LunchBox Braced Grid Stucture 1D.dyf (Dynamo 0.6.3.38253)
# category: LunchBox.Geometry.Structure
# Creates a 1D braced grid structure on a surface

number = DoubleInput(0)
Face = Input()
evaluate_surface = XyzEvaluate(arg1=Face, lacing=Longest)
number_2 = DoubleInput(0)
U = Input()
V = Input()
list = NewList(index0=U, index1=V)
python_script = Python(list)
# ---------- python_script.python (52 lines) ----------
#Copyright(c) 2014, Nathan Miller
# The Proving Ground, http://theprovingground.org

# Default imports
import clr
clr.AddReference('RevitAPI')
clr.AddReference('RevitAPIUI')
from Autodesk.Revit.DB import *
import Autodesk

#The input to this node will be stored in the IN variable.
dataEnteringNode = IN

udiv = dataEnteringNode[0]
vdiv = dataEnteringNode[1]

ustep = 1/udiv
vstep = 1/vdiv

lnsA = []
lnsB = []
lnsC = []
lns = []
for i in range(0,int(udiv)+1):
	for j in range(0,int(vdiv)+1):
		lnB = []
		lnA = []
		lnC = []
		
		ptA = UV(i*ustep, j*vstep)
		if i<udiv:
			ptB = UV((i+1)*ustep, j*vstep)
			lnA.append(ptA)
			lnA.append(ptB)
			lnsA.append(lnA)
		if j<vdiv:
			ptB = UV(i*ustep, (j+1)*vstep)
			lnB.append(ptA)
			lnB.append(ptB)
			lnsB.append(lnB)
		if i<udiv and j<vdiv:
			bptA = UV(i * ustep, j * vstep)
			bptB = UV((i + 1) * ustep, (j + 1) * vstep)
			lnC.append(bptA)
			lnC.append(bptB)
			lnsC.append(lnC)

lns.append(lnsA)
lns.append(lnsB)
lns.append(lnsC)
#Assign your output to the OUT variable
OUT = lns
# ----------------------------------------
get_from_list = GetFromList(number_2, python_script)
map = Map(evaluate_surface, get_from_list)
transpose_lists = Transpose(map)
get_from_list_2 = GetFromList(number, transpose_lists)
number_3 = DoubleInput(1)
get_from_list_3 = GetFromList(number_3, transpose_lists)
line_by_endpoints = LineBound(get_from_list_2, get_from_list_3, lacing=Longest)
lnsA = Output(line_by_endpoints)
number_4 = DoubleInput(0)
number_5 = DoubleInput(1)
get_from_list_4 = GetFromList(number_5, python_script)
map_2 = Map(evaluate_surface, get_from_list_4)
transpose_lists_2 = Transpose(map_2)
get_from_list_5 = GetFromList(number_4, transpose_lists_2)
number_6 = DoubleInput(1)
get_from_list_6 = GetFromList(number_6, transpose_lists_2)
line_by_endpoints_2 = LineBound(get_from_list_5, get_from_list_6, lacing=Longest)
lnsB = Output(line_by_endpoints_2)
number_7 = DoubleInput(0)
number_8 = DoubleInput(2)
get_from_list_7 = GetFromList(number_8, python_script)
map_3 = Map(evaluate_surface, get_from_list_7)
transpose_lists_3 = Transpose(map_3)
get_from_list_8 = GetFromList(number_7, transpose_lists_3)
number_9 = DoubleInput(1)
get_from_list_9 = GetFromList(number_9, transpose_lists_3)
line_by_endpoints_3 = LineBound(get_from_list_8, get_from_list_9, lacing=Longest)
lnsC = Output(line_by_endpoints_3)
