# Dynamo custom node LunchBox Curtain Panel Collector.dyf (Dynamo 0.6.3.38253)
# category: LunchBox.Revit.Elements
# Collects curtain panel instances and references them.

number = DoubleInput(0)
FamilyName = Input()
python_script = Python(FamilyName)
# ---------- python_script.python (58 lines) ----------
#Copyright(c) 2014, Nathan Miller
# The Proving Ground, http://theprovingground.org
# Default imports
import clr
clr.AddReference('RevitAPI')
clr.AddReference('RevitAPIUI')
from Autodesk.Revit.DB import *

import Autodesk
import sys
import clr
path = r'C:\Autodesk\Dynamo\Core'
exec_path = r'C:\Autodesk\Dynamo\Core\dll'
sys.path.append(path)
sys.path.append(exec_path)
clr.AddReference('LibGNet')
from Autodesk.LibG import *

doc = __doc__

name = IN

collector = FilteredElementCollector(doc)
collector.OfCategory(BuiltInCategory.OST_CurtainWallPanels)
collector.OfClass(FamilyInstance)
 
famtypeitr = collector.GetElementIdIterator()
famtypeitr.Reset()

output = []
inst = []
location = []
elementids = []
uniqueids = []
for item in famtypeitr:
    famtypeID = item
    faminst = doc.GetElement(famtypeID)
    #print faminst
 
    if faminst.Symbol.Family.Name == name:
    	geooptions =  Autodesk.Revit.DB.Options()
    	geoarr = faminst.get_Geometry(geooptions)
    	for geo in geoarr:
    		panel = geo.GetInstanceGeometry()
    		for pan in panel:
    			location.append(pan)
    		
        inst.append(faminst)
        elementids.append(faminst.Id.ToString())
        uniqueids.append(faminst.UniqueId)
        
output.append(inst)
output.append(location)
output.append(elementids)
output.append(uniqueids)
        
#Assign your output to the OUT variable
OUT = output
# ----------------------------------------
get_from_list = GetFromList(number, python_script)
PanelElements = Output(get_from_list)
number_2 = DoubleInput(1)
get_from_list_2 = GetFromList(number_2, python_script)
Solids = Output(get_from_list_2)
number_3 = DoubleInput(2)
get_from_list_3 = GetFromList(number_3, python_script)
Element_ID = Output(get_from_list_3)
number_4 = DoubleInput(3)
get_from_list_4 = GetFromList(number_4, python_script)
Unique_ID = Output(get_from_list_4)
