# Dynamo custom node LunchBox Deconstruct Face.dyf (Dynamo 0.6.3.38253)
# category: LunchBox.Geometry.Utilities
# Gets the edges and vertices of a face.

number = DoubleInput(0)
Faces = Input()
python_script = Python(Faces)
# ---------- python_script.python (65 lines) ----------
#Copyright (c) 2014, Nathan Miller
#The Proving Ground, http://TheProvingGround.org
# Default imports
import clr
clr.AddReference('RevitAPI')
clr.AddReference('RevitAPIUI')
from Autodesk.Revit.DB import *
import Autodesk
import sys
import clr
path = r'C:\Autodesk\Dynamo\Core'
exec_path = r'C:\Autodesk\Dynamo\Core\dll'
sys.path.append(path)
sys.path.append(exec_path)
clr.AddReference('LibGNet')
from Autodesk.LibG import *

#The input to this node will be stored in the IN variable.
faces = IN

#output
output = []
edges = []
vertices = []
if hasattr(faces, '__iter__'):
	for face in faces:
		loops = face.EdgeLoops
		edgesloop = []
		vertsloop = []
		for loop in loops:
			edgeloop = []
			vertloop = []
			for edge in loop:
				crv = edge.AsCurve()
				pt = edge.Evaluate(0)
				edgeloop.append(crv)
				vertloop.append(pt)
			edgesloop.append(edgeloop)
			vertsloop.append(vertloop)
	
		edges.append(edgesloop)
		vertices.append(vertsloop)
else:
	loops = faces.EdgeLoops
	edgesloop = []
	vertsloop = []
	for loop in loops:
		edgeloop = []
		vertloop = []
		for edge in loop:
			crv = edge.AsCurve()
			pt = edge.Evaluate(0)
			edgeloop.append(crv)
			vertloop.append(pt)
		edgesloop.append(edgeloop)
		vertsloop.append(vertloop)
	
	edges.append(edgesloop)
	vertices.append(vertsloop)

output.append(edges)
output.append(vertices)

#Assign your output to the OUT variable
OUT = output
# ----------------------------------------
get_from_list = GetFromList(number, python_script)
Edges = Output(get_from_list)
number_2 = DoubleInput(1)
get_from_list_2 = GetFromList(number_2, python_script)
Vertices = Output(get_from_list_2)
