# Dynamo custom node LunchBox Deconstruct Solid.dyf (Dynamo 0.6.3.38253)
# category: LunchBox.Geometry.Utilities
# Deconstructs a solid into faces, edges, and vertices

number = DoubleInput(0)
Solid = Input()
python_script = Python(Solid)
# ---------- python_script.python (88 lines) ----------
#Copyright(c) 2014, Nathan Miller
# The Proving Ground, http://theprovingground.org
# Default imports
import clr
clr.AddReference('RevitAPI')
clr.AddReference('RevitAPIUI')
from Autodesk.Revit.DB import *
import Autodesk
import sys
import clr
path = r'C:\Autodesk\Dynamo\Core'
exec_path = r'C:\Autodesk\Dynamo\Core\dll'
sys.path.append(path)
sys.path.append(exec_path)
clr.AddReference('LibGNet')
from Autodesk.LibG import *

#The input to this node will be stored in the IN variable.
solids = IN

faces = []
edges = []
vertices = []
if hasattr(solids, "__iter__"):
	for solid in solids:
		if hasattr(solid, "__iter__"):
			for sol in solid:
				fcs = []
				edgs = []
				verts = []
				for face in solid.Faces:
					fcs.append(face)
	
				for edge in solid.Edges:
					crv = edge.AsCurve()
					edgs.append(crv)
		
					pt = crv.Evaluate(0, True)
					verts.append(pt)
		
				faces.append(fcs)
				edges.append(edgs)
				vertices.append(verts)
		else:
			fcs = []
			edgs = []
			verts = []
			for face in solid.Faces:
				fcs.append(face)
	
			for edge in solid.Edges:
				crv = edge.AsCurve()
				edgs.append(crv)
		
				pt = crv.Evaluate(0, True)
				verts.append(pt)
		
			faces.append(fcs)
			edges.append(edgs)
			vertices.append(verts)
else:
	fcs = []
	edgs = []
	verts = []
	for face in solids.Faces:
		fcs.append(face)
	
	for edge in solids.Edges:
		crv = edge.AsCurve()
		edgs.append(crv)
		
		pt = crv.Evaluate(0, True)
		verts.append(pt)
		
	faces.append(fcs)
	edges.append(edgs)
	vertices.append(verts)

	
	
output = []
output.append(faces)
output.append(edges)
output.append(vertices)
	

#Assign your output to the OUT variable
OUT = output
# ----------------------------------------
get_from_list = GetFromList(number, python_script)
Faces = Output(get_from_list)
number_2 = DoubleInput(1)
get_from_list_2 = GetFromList(number_2, python_script)
Edges = Output(get_from_list_2)
number_3 = DoubleInput(2)
get_from_list_3 = GetFromList(number_3, python_script)
Vertices = Output(get_from_list_3)
