# Dynamo custom node LunchBox Diamond Grid by Face.dyf (Dynamo 0.6.2.29585)
# category: LunchBox.Geometry.Panel
# Create a Diamond XYZ grid on a face.  The face surface must have an untrimmed UV parameter space.

Face = Input()
evaluate_uv = XyzEvaluate(arg1=Face, lacing=Longest)
U = Input()
V = Input()
list = NewList(index0=U, index1=V)
python_script = Python(list)
# ---------- python_script.python (60 lines) ----------
#Copyright(c) 2014, Nathan Miller
# The Proving Ground, http://theprovingground.org

# Default imports
import clr
clr.AddReference('RevitAPI')
clr.AddReference('RevitAPIUI')
from Autodesk.Revit.DB import *
import Autodesk

#The input to this node will be stored in the IN variable.
dataEnteringNode = IN

udiv = dataEnteringNode[0]
vdiv = dataEnteringNode[1]

ustep = 1/udiv
vstep = 1/vdiv

quads = []
for i in range(0,int(udiv+1)):
	for j in range(0,int(vdiv+1)):
		if (i+j)%2 == 0:
			ptA = UV(0,0)
			ptB = UV(0,0)
			ptC = UV(0,0)
			ptD = UV(0,0)
		
			if i>0:
				ptA = UV((i-1)*ustep,j*vstep)
			else:
				ptB = UV(i*ustep,j*vstep)
			
			if j>0:
				ptB = UV(i*ustep,(j-1)*vstep)
			else:
				ptB = UV(i*ustep,j*vstep)
				
			if i<udiv:
				ptC = UV((i+1)*ustep,j*vstep)
			else:
				ptC = UV(i*ustep,j*vstep)
			
			if j<=(vdiv -1):
				ptD = UV(i*ustep,(j+1)*vstep)
			else:
				ptD = UV(i*ustep,j*vstep)
				
			if i>0 and j>0 and i<udiv and j<=(vdiv-1):
				quad = []
				#Append to quad
				quad.append(ptA)
				quad.append(ptB)
				quad.append(ptC)
				quad.append(ptD)
				#Append quads
				quads.append(quad)

#Assign your output to the OUT variable
OUT = quads
# ----------------------------------------
map = Map(evaluate_uv, python_script)
XYZ1 = Output(map)
python_script_2 = Python(list)
# ---------- python_script_2.python (127 lines) ----------
# Nathan Miller, 2013
# The Proving Ground, http://theprovingground.org

# Default imports
import clr
clr.AddReference('RevitAPI')
clr.AddReference('RevitAPIUI')
from Autodesk.Revit.DB import *
import Autodesk

#The input to this node will be stored in the IN variable.
dataEnteringNode = IN

udiv = dataEnteringNode[0]
vdiv = dataEnteringNode[1]

ustep = 1/udiv
vstep = 1/vdiv
quads = []
udivs = []
for i in range(0,int(udiv+1)):
	for j in range(0,int(vdiv+1)):
		if (i+j)%2 == 0:
			ptA = UV(0,0)
			ptB = UV(0,0)
			ptC = UV(0,0)
			ptD = UV(0,0)
		
			if i>0:
				ptA = UV((i-1)*ustep,j*vstep)
			else:
				ptB = UV(i*ustep,j*vstep)
			
			if j>0:
				ptB = UV(i*ustep,(j-1)*vstep)
			else:
				ptB = UV(i*ustep,j*vstep)
				
			if i<udiv:
				ptC = UV((i+1)*ustep,j*vstep)
			else:
				ptC = UV(i*ustep,j*vstep)
			
			if j<=(vdiv -1):
				ptD = UV(i*ustep,(j+1)*vstep)
			else:
				ptD = UV(i*ustep,j*vstep)
				
			if i>0 and j>0 and i<udiv and j<vdiv:
				quad = []
			else:
				udivs.append(j)
				if i==0 and j==0:
					quad = []
					#Append to quad
					quad.append(ptB)
					quad.append(ptC)
					quad.append(ptD)
					#Append quads
					quads.append(quad)
					
				if i==0 and j==vdiv:
					quad = []
					#Append to quad
					quad.append(ptB)
					quad.append(ptC)
					quad.append(ptD)
					#Append quads
					quads.append(quad)
					
				if i==udiv and j==0:
					quad = []
					#Append to quad
					quad.append(ptC)
					quad.append(ptD)
					quad.append(ptA)
					#Append quads
					quads.append(quad)
				
				if i==udiv and j==vdiv:
					quad = []
					#Append to quad
					quad.append(ptA)
					quad.append(ptB)
					quad.append(ptC)
					#Append quads
					quads.append(quad)
				
				
				if i == 0 and j > 0 and j < vdiv:
					quad = []
					#Append to quad
					quad.append(ptB)
					quad.append(ptC)
					quad.append(ptD)
					#Append quads
					quads.append(quad)
					
				if i == udiv and j > 0 and j < vdiv:
					quad = []
					#Append to quad
					quad.append(ptA)
					quad.append(ptB)
					quad.append(ptD)
					#Append quads
					quads.append(quad)
					
				if j == 0 and i > 0 and i < udiv:
					quad = []
					#Append to quad
					quad.append(ptA)
					quad.append(ptC)
					quad.append(ptD)
					#Append quads
					quads.append(quad)
					
				if j == vdiv and i > 0 and i < udiv:
					quad = []
					#Append to quad
					quad.append(ptA)
					quad.append(ptB)
					quad.append(ptC)
					#Append quads
					quads.append(quad)

#Assign your output to the OUT variable
OUT = quads
# ----------------------------------------
map_2 = Map(evaluate_uv, python_script_2)
XYZ2 = Output(map_2)
watch = Watch(python_script_2)
