# Dynamo custom node LunchBox Domain Variables.dyf (Dynamo 0.6.2.26406)
# category: LunchBox.Math.Domain
# Gets the Min and Max variables of a Domain.

Domain = Input()
python_script = Python(Domain)
# ---------- python_script.python (24 lines) ----------
#Copyright(c) 2014, Nathan Miller
# The Proving Ground, http://theprovingground.org
# Default imports
import clr
clr.AddReference('RevitAPI')
clr.AddReference('RevitAPIUI')
from Autodesk.Revit.DB import *
import Autodesk
import sys
import clr
path = r'C:\Autodesk\Dynamo\Core'
exec_path = r'C:\Autodesk\Dynamo\Core\dll'
sys.path.append(path)
sys.path.append(exec_path)
clr.AddReference('LibGNet')
from Autodesk.LibG import *

#The input to this node will be stored in the IN variable

domain = IN
min = domain.Min

#Assign your output to the OUT variable
OUT = min
# ----------------------------------------
Min = Output(python_script)
python_script_2 = Python(Domain)
# ---------- python_script_2.python (22 lines) ----------
# Default imports
import clr
clr.AddReference('RevitAPI')
clr.AddReference('RevitAPIUI')
from Autodesk.Revit.DB import *
import Autodesk
import sys
import clr
path = r'C:\Autodesk\Dynamo\Core'
exec_path = r'C:\Autodesk\Dynamo\Core\dll'
sys.path.append(path)
sys.path.append(exec_path)
clr.AddReference('LibGNet')
from Autodesk.LibG import *

#The input to this node will be stored in the IN variable

domain = IN
max = domain.Max

#Assign your output to the OUT variable
OUT = max
# ----------------------------------------
Max = Output(python_script_2)
