# Dynamo custom node LunchBox Floor Element Collector.dyf (Dynamo 0.6.3.38253)
# category: LunchBox.Revit.Elements
# Collects Floor elements from the current Revit document.

number = DoubleInput(0)
Floor_Type = Input()
python_script = Python(Floor_Type)
# ---------- python_script.python (111 lines) ----------
#Copyright(c) 2014, Nathan Miller
# The Proving Ground, http://theprovingground.org
# Default imports
import clr
clr.AddReference('RevitAPI')
clr.AddReference('RevitAPIUI')
from Autodesk.Revit.DB import *
import Autodesk
import sys
import clr
path = r'C:\Autodesk\Dynamo\Core'
exec_path = r'C:\Autodesk\Dynamo\Core\dll'
sys.path.append(path)
sys.path.append(exec_path)
clr.AddReference('LibGNet')
from Autodesk.LibG import *

#The input to this node will be stored in the IN variable.

doc = __doc__
app = __revit__.Application

floortype = IN

collector = FilteredElementCollector(doc)
collector.OfClass(Floor)
 
famtypeitr = collector.GetElementIdIterator()
famtypeitr.Reset()

output = []
floors = []
levels = []
areas = []
boundaries = []
locations = []
elementids = []
uniqueids = []
for item in famtypeitr:
    famtypeID = item
    faminst = doc.GetElement(famtypeID)
    if floortype == '*':
    	floor = faminst
    	level = floor.Parameter['Level'].AsValueString()
    	area = floor.Parameter['Area'].AsDouble()
    	elementid = faminst.Id.ToString()
    	uniqueid = faminst.UniqueId
    	
    	boptions = app.Create.NewGeometryOptions()
    	floorgeo = floor.get_Geometry(boptions)
    	faces = []
    	for geo in floorgeo:
    		instance = geo		
    		solidface = instance.Faces
    		for face in solidface:
    			faces.append(face)
    
		edgeloops = faces[1].EdgeLoops
		edges = []
		for loop in edgeloops:
			edgs = []
			for edge in loop:
				edgs.append(edge.AsCurve())
			edges.append(edgs)
    	
    	floors.append(floor)
    	boundaries.append(edges)
    	levels.append(level)
    	areas.append(area)
    	elementids.append(elementid)
    	uniqueids.append(uniqueid)    
    elif faminst.FloorType.Id == floortype.Id:
    	floor = faminst
    	level = floor.Parameter['Level'].AsValueString()
    	area = floor.Parameter['Area'].AsDouble()
    	elementid = faminst.Id.ToString()
    	uniqueid = faminst.UniqueId
    	
    	boptions = app.Create.NewGeometryOptions()
    	floorgeo = floor.get_Geometry(boptions)
    	faces = []
    	for geo in floorgeo:
    		instance = geo		
    		solidface = instance.Faces
    		for face in solidface:
    			faces.append(face)
    
		edgeloops = faces[1].EdgeLoops
		edges = []
		for loop in edgeloops:
			edgs = []
			for edge in loop:
				edgs.append(edge.AsCurve())
			edges.append(edgs)
    	
    	floors.append(floor)
    	boundaries.append(edges)
    	levels.append(level)
    	areas.append(area)
    	elementids.append(elementid)
    	uniqueids.append(uniqueid)
        
output.append(floors)
output.append(boundaries)
output.append(levels)
output.append(areas)
output.append(elementids)
output.append(uniqueids)
        
#Assign your output to the OUT variable
OUT = output
# ----------------------------------------
get_from_list = GetFromList(number, python_script)
Floor_Element = Output(get_from_list)
solid_from_element = ElementSolid(get_from_list, lacing=Longest)
Solid = Output(solid_from_element)
number_2 = DoubleInput(1)
get_from_list_2 = GetFromList(number_2, python_script)
Floor_Boundary = Output(get_from_list_2)
number_3 = DoubleInput(2)
get_from_list_3 = GetFromList(number_3, python_script)
Level = Output(get_from_list_3)
number_4 = DoubleInput(3)
get_from_list_4 = GetFromList(number_4, python_script)
Area = Output(get_from_list_4)
number_5 = DoubleInput(4)
get_from_list_5 = GetFromList(number_5, python_script)
Element_ID = Output(get_from_list_5)
number_6 = DoubleInput(5)
get_from_list_6 = GetFromList(number_6, python_script)
Unique_ID = Output(get_from_list_6)
