# Dynamo custom node LunchBox Get Domain.dyf (Dynamo 0.6.2.26406)
# category: LunchBox.Math.Domain
# Gets the domain from a list of numbers.

number = DoubleInput(0)
Numbers = Input()
python_script = Python(Numbers)
# ---------- python_script.python (36 lines) ----------
#Copyright(c) 2014, Nathan Miller
# The Proving Ground, http://theprovingground.org
# Default imports
import clr
clr.AddReference('RevitAPI')
clr.AddReference('RevitAPIUI')
from Autodesk.Revit.DB import *
import Autodesk
import sys
import clr
path = r'C:\Autodesk\Dynamo\Core'
exec_path = r'C:\Autodesk\Dynamo\Core\dll'
sys.path.append(path)
sys.path.append(exec_path)
clr.AddReference('LibGNet')
from Autodesk.LibG import *
import System


#The input to this node will be stored in the IN variable.
list = IN

sort = []
for i in range(0,len(list)):
	sort.append(list[i])

sort.sort()
min = sort[0]
max = sort[(len(sort)-1)]

dom = []
dom.append(min)
dom.append(max)

#Assign your output to the OUT variable
OUT = dom
# ----------------------------------------
get_from_list = GetFromList(number, python_script)
number_2 = DoubleInput(1)
get_from_list_2 = GetFromList(number_2, python_script)
domain = Domain(get_from_list, get_from_list_2)
Domain = Output(domain)
