# Dynamo custom node LunchBox Get Parameter Value.dyf (Dynamo 0.6.3.38253)
# category: LunchBox.Revit.Parameters
# Gets parameter values from a Revit element.

Element = Input()
ParamName = Input()
list = NewList(index0=Element, index1=ParamName)
python_script = Python(list)
# ---------- python_script.python (43 lines) ----------
#Copyright (c) 2014, Nathan Miller
#The Proving Ground http://theprovingground.org
# Default imports
import clr
clr.AddReference('RevitAPI')
clr.AddReference('RevitAPIUI')
from Autodesk.Revit.DB import *
import Autodesk
import sys
import clr
path = r'C:\Autodesk\Dynamo\Core'
exec_path = r'C:\Autodesk\Dynamo\Core\dll'
sys.path.append(path)
sys.path.append(exec_path)
clr.AddReference('LibGNet')
from Autodesk.LibG import *

#The input to this node will be stored in the IN variable.
elements = IN[0]
parameter = IN[1]

values = []
if hasattr(elements, "__iter__"):
	output = []
	for elem in elements:
		if hasattr(elem, "__iter__"):
			vals = []
			for e in elem:
				parm = 	elem.Parameter[parameter].AsValueString()
				vals.append(parm)
			values.append(vals)
		else:
			parm = 	elem.Parameter[parameter].AsValueString()
			values.append(parm)
	output.append(values)
else:
	parm = 	elements.Parameter[parameter].AsValueString()
	output = parm



#Assign your output to the OUT variable
OUT = output
# ----------------------------------------
Value = Output(python_script)
