# Dynamo custom node LunchBox Level Element Collector.dyf (Dynamo 0.6.2.29585)
# category: LunchBox.Revit.Elements
# Collects Levels from the current Level document

number = DoubleInput(0)
number_2 = DoubleInput(0)
python_script = Python(number_2)
# ---------- python_script.python (59 lines) ----------
#Copyright(c) 2014, Nathan Miller
# The Proving Ground, http://theprovingground.org
# Default imports
import clr
clr.AddReference('RevitAPI')
clr.AddReference('RevitAPIUI')
from Autodesk.Revit.DB import *
import Autodesk
import sys
import clr
path = r'C:\Autodesk\Dynamo\Core'
exec_path = r'C:\Autodesk\Dynamo\Core\dll'
sys.path.append(path)
sys.path.append(exec_path)
clr.AddReference('LibGNet')
from Autodesk.LibG import *

#The input to this node will be stored in the IN variable.

doc = __doc__

collector = FilteredElementCollector(doc)
collector.OfCategory(BuiltInCategory.OST_Levels)
collector.OfClass(Level)
 
famtypeitr = collector.GetElementIdIterator()
famtypeitr.Reset()

output = []
levels = []
names = []
areas = []
elevations = []
elementids = []
uniqueids = []
for item in famtypeitr:
    famtypeID = item
    faminst = doc.GetElement(famtypeID)
    
    level = faminst
    levelname = faminst.Parameter['Name'].AsString()
    elevation = faminst.Elevation
    elementid = faminst.Id
    uniqueid = faminst.UniqueId
    	
    levels.append(level)
    names.append(levelname)
    elevations.append(elevation)
    elementids.append(elementid)
    uniqueids.append(uniqueid)
        
output.append(levels)
output.append(names)
output.append(elevations)
output.append(elementids)
output.append(uniqueids)
        
#Assign your output to the OUT variable
OUT = output
# ----------------------------------------
get_from_list = GetFromList(number, python_script)
Level = Output(get_from_list)
number_3 = DoubleInput(1)
get_from_list_2 = GetFromList(number_3, python_script)
Name = Output(get_from_list_2)
number_4 = DoubleInput(2)
get_from_list_3 = GetFromList(number_4, python_script)
Elevation = Output(get_from_list_3)
number_5 = DoubleInput(3)
get_from_list_4 = GetFromList(number_5, python_script)
Element_ID = Output(get_from_list_4)
number_6 = DoubleInput(4)
get_from_list_5 = GetFromList(number_6, python_script)
Unique_ID = Output(get_from_list_5)
