# Dynamo custom node LunchBox Mass Multiplication.dyf (Dynamo 0.6.2.26406)
# category: LunchBox.Math.Operators
# Returns the total value of a list of numbers.

Numbers = Input()
python_script = Python(Numbers)
# ---------- python_script.python (26 lines) ----------
# Default imports
import clr
clr.AddReference('RevitAPI')
clr.AddReference('RevitAPIUI')
from Autodesk.Revit.DB import *
import Autodesk
import sys
import clr
path = r'C:\Autodesk\Dynamo\Core'
exec_path = r'C:\Autodesk\Dynamo\Core\dll'
sys.path.append(path)
sys.path.append(exec_path)
clr.AddReference('LibGNet')
from Autodesk.LibG import *

#The input to this node will be stored in the IN variable.
list = IN
mass = IN[0]
if hasattr(list, "__iter__"):
    for i in range(1,len(list)):
	mass = mass * list[i]
else:
    mass = list

#Assign your output to the OUT variable
OUT = mass
# ----------------------------------------
Result = Output(python_script)
python_script_2 = Python(Numbers)
# ---------- python_script_2.python (30 lines) ----------
#Copyright(c) 2014, Nathan Miller
# The Proving Ground, http://theprovingground.org
# Default imports
import clr
clr.AddReference('RevitAPI')
clr.AddReference('RevitAPIUI')
from Autodesk.Revit.DB import *
import Autodesk
import sys
import clr
path = r'C:\Autodesk\Dynamo\Core'
exec_path = r'C:\Autodesk\Dynamo\Core\dll'
sys.path.append(path)
sys.path.append(exec_path)
clr.AddReference('LibGNet')
from Autodesk.LibG import *

#The input to this node will be stored in the IN variable.
list = IN
mass = IN[0]
masspart = []
if hasattr(list, "__iter__"):
    for i in range(1,len(list)):
	mass = mass * list[i]
	masspart.append(mass)
else:
    masspart.append(list)

#Assign your output to the OUT variable
OUT = masspart
# ----------------------------------------
Partials = Output(python_script_2)
