# Dynamo custom node LunchBox Quad Grid by Face.dyf (Dynamo 0.6.3.38253)
# category: LunchBox.Geometry.Panel
# Create a quadrangular XYZ grid on a face.  The face surface must have an untrimmed UV parameter space.

Face = Input()
evaluate_uv = XyzEvaluate(arg1=Face, lacing=Longest)
U = Input()
V = Input()
list = NewList(index0=U, index1=V)
python_script = Python(list)
# ---------- python_script.python (38 lines) ----------
#Copyright(c) 2014, Nathan Miller
# The Proving Ground, http://theprovingground.org

# Default imports
import clr
clr.AddReference('RevitAPI')
clr.AddReference('RevitAPIUI')
from Autodesk.Revit.DB import *
import Autodesk

#The input to this node will be stored in the IN variable.
dataEnteringNode = IN

udiv = dataEnteringNode[0]
vdiv = dataEnteringNode[1]

ustep = 1/udiv
vstep = 1/vdiv

quads = []
for i in range(0,int(udiv)):
	for j in range(0,int(vdiv)):
		quad = []
		#XYZ Quads
		myXYZA = UV(i*ustep, j*vstep)
		myXYZB = UV((i+1)*ustep,j*vstep)
		myXYZC = UV((i+1)*ustep,(j+1)*vstep)
		myXYZD = UV(i*ustep,(j+1)*vstep)
		#Append to quad
		quad.append(myXYZA)
		quad.append(myXYZB)
		quad.append(myXYZC)
		quad.append(myXYZD)
		#Append quads
		quads.append(quad)

#Assign your output to the OUT variable
OUT = quads
# ----------------------------------------
map = Map(evaluate_uv, python_script)
XYZ = Output(map)
