# Dynamo custom node LunchBox Random Numbers.dyf (Dynamo 0.6.2.26406)
# category: LunchBox.Math.Random
# Generates a list of Random numbers using a domain, amount, and seed.

Domain = Input()
Amount = Input()
Seed = Input()
list = NewList(index0=Domain, index1=Amount, index2=Seed)
python_script = Python(list)
# ---------- python_script.python (52 lines) ----------
#Copyright(c) 2014, Nathan Miller
# The Proving Ground, http://theprovingground.org
# Default imports
import clr
clr.AddReference('RevitAPI')
clr.AddReference('RevitAPIUI')
from Autodesk.Revit.DB import *
import Autodesk
import sys
import clr
path = r'C:\Autodesk\Dynamo\Core'
exec_path = r'C:\Autodesk\Dynamo\Core\dll'
sys.path.append(path)
sys.path.append(exec_path)
clr.AddReference('LibGNet')
from Autodesk.LibG import *
import System


dom = IN[0]
num = IN[1]
seed = IN[2]

dmin = dom.Min
dmax = dom.Max
drange = dmax - dmin

random = System.Random(seed)

# Generate some random floats
list = []
for i in range(0,int(num)):
	rand = random.NextDouble()
	list.append(rand)

# Remap numbers
l = []
for i in range(0,len(list)):
	l.append(list[i])

l.sort()
listMin = l[0]
listMax = l[(len(list)-1)]
listRange = listMax-listMin

mapped = []
for i in range(0,len(list)):
	scaled = dmin + (((list[i] - listMin) / listRange) * drange)
	mapped.append(scaled)

#Assign your output to the OUT variable
OUT = mapped
# ----------------------------------------
Random = Output(python_script)
