# Dynamo custom node LunchBox Random Split List.dyf (Dynamo 0.6.2.26406)
# category: LunchBox.Math.Random
# Randomly splits a list of objects into two separate lists.

number = DoubleInput(0)
List = Input()
Ratio = Input()
Seed = Input()
list = NewList(index0=List, index1=Ratio, index2=Seed)
python_script = Python(list)
# ---------- python_script.python (42 lines) ----------
#Copyright(c) 2014, Nathan Miller
# The Proving Ground, http://theprovingground.org
# Default imports
import clr
clr.AddReference('RevitAPI')
clr.AddReference('RevitAPIUI')
from Autodesk.Revit.DB import *
import Autodesk
import sys
import clr
path = r'C:\Autodesk\Dynamo\Core'
exec_path = r'C:\Autodesk\Dynamo\Core\dll'
sys.path.append(path)
sys.path.append(exec_path)
clr.AddReference('LibGNet')
from Autodesk.LibG import *
import System

#The input to this node will be stored in the IN variable.
dataEnteringNode = IN

list = IN[0]
split = IN[1]
seed = IN[2]

master = []
listA = []
listB = []

rand = System.Random(seed)

for i in range(0,len(list)):
	num = rand.NextDouble()
	if num <= split:
		listA.append(list[i])
	else:
		listB.append(list[i])
		
master.append(listA)
master.append(listB)
#Assign your output to the OUT variable
OUT = master
# ----------------------------------------
get_from_list = GetFromList(number, python_script)
ListA = Output(get_from_list)
number_2 = DoubleInput(1)
get_from_list_2 = GetFromList(number_2, python_script)
ListB = Output(get_from_list_2)
