# Dynamo custom node LunchBox Remap Numbers.dyf (Dynamo 0.6.2.26406)
# category: LunchBox.Math.Domain
# Remaps a list of numbers to a new domain.

Numbers = Input()
Domain = Input()
list = NewList(index0=Numbers, index1=Domain)
python_script = Python(list)
# ---------- python_script.python (42 lines) ----------
#Copyright(c) 2014, Nathan Miller
# The Proving Ground, http://theprovingground.org
# Default imports
import clr
clr.AddReference('RevitAPI')
clr.AddReference('RevitAPIUI')
from Autodesk.Revit.DB import *
import Autodesk
import sys
import clr
path = r'C:\Autodesk\Dynamo\Core'
exec_path = r'C:\Autodesk\Dynamo\Core\dll'
sys.path.append(path)
sys.path.append(exec_path)
clr.AddReference('LibGNet')
from Autodesk.LibG import *

#The input to this node will be stored in the IN variable.
list = IN[0]
dom = IN[1]

dmin = dom.Min
dmax = dom.Max
drange = dmax-dmin

l = []
for i in range(0,len(list)):
	l.append(list[i])

l.sort()
listMin = l[0]
listMax = l[(len(list)-1)]
listRange = listMax-listMin

mapped = []
for i in range(0,len(list)):
	scaled = dmin + (((list[i] - listMin) / listRange) * drange)
	mapped.append(scaled)


#Assign your output to the OUT variable
OUT = mapped
# ----------------------------------------
Remapped = Output(python_script)
