# Dynamo custom node LunchBox Remove Null Values.dyf (Dynamo 0.6.3.38253)
# category: LunchBox.Format
# Remove 'null' values from a list.

List = Input()
python_script = Python(List)
# ---------- python_script.python (30 lines) ----------
# Default imports
import clr
clr.AddReference('RevitAPI')
clr.AddReference('RevitAPIUI')
from Autodesk.Revit.DB import *
import Autodesk
import sys
import clr
path = r'C:\Autodesk\Dynamo\Core'
exec_path = r'C:\Autodesk\Dynamo\Core\dll'
sys.path.append(path)
sys.path.append(exec_path)
clr.AddReference('LibGNet')
from Autodesk.LibG import *

#The input to this node will be stored in the IN variable.
list = IN

cleanlist = []
for i in list:
	if hasattr(i, "__iter__"):
		for ii in i:
			if not (i is None):
				cleanlist.append(i)	
	else:
		if not (i is None):
			cleanlist.append(i)	

#Assign your output to the OUT variable
OUT = cleanlist
# ----------------------------------------
Cleaned = Output(python_script)
