# Dynamo custom node LunchBox Room Element Collector.dyf (Dynamo 0.6.3.38253)
# category: LunchBox.Revit.Elements
# Collects rooms from the Revit document

number = DoubleInput(0)
number_2 = DoubleInput(0)
python_script = Python(number_2)
# ---------- python_script.python (80 lines) ----------
#Copyright(c) 2014, Nathan Miller
# The Proving Ground, http://theprovingground.org
# Default imports
import clr
clr.AddReference('RevitAPI')
clr.AddReference('RevitAPIUI')
from Autodesk.Revit.DB import *
import Autodesk
import sys
import clr
path = r'C:\Autodesk\Dynamo\Core'
exec_path = r'C:\Autodesk\Dynamo\Core\dll'
sys.path.append(path)
sys.path.append(exec_path)
clr.AddReference('LibGNet')
from Autodesk.LibG import *

#The input to this node will be stored in the IN variable.

doc = __doc__

collector = FilteredElementCollector(doc)
collector.OfCategory(BuiltInCategory.OST_Rooms)
 
famtypeitr = collector.GetElementIdIterator()
famtypeitr.Reset()

output = []
rooms = []
names = []
numbers = []
areas = []
boundaries = []
locations = []
elementids = []
uniqueids = []
for item in famtypeitr:
    famtypeID = item
    faminst = doc.GetElement(famtypeID)
    
    #print faminst
    if faminst.Area > 0:
    	room = faminst
    	roomname = faminst.Parameter['Name'].AsString()
    	number = faminst.Number
    	area = faminst.Area
    	location = faminst.Location.Point
    	elementid = faminst.Id.ToString()
    	uniqueid = faminst.UniqueId
    	
    	boptions = Autodesk.Revit.DB.SpatialElementBoundaryOptions()
    	boundsegs = room.GetBoundarySegments(boptions)
    	boundcurves = []
    	for bound in boundsegs:
    		crvs = []
    		for seg in bound:
    			crv = seg.Curve
    			crvs.append(crv)
    		boundcurves.append(crvs)
    	
    	rooms.append(room)
        names.append(roomname)
        numbers.append(number)
        areas.append(area)
        boundaries.append(boundcurves)
        locations.append(location)
        elementids.append(elementid)
        uniqueids.append(uniqueid)
        
output.append(rooms)
output.append(names)
output.append(numbers)
output.append(areas)
output.append(boundaries)
output.append(locations)
output.append(elementids)
output.append(uniqueids)
        
#Assign your output to the OUT variable
OUT = output
# ----------------------------------------
get_from_list = GetFromList(number, python_script)
Room = Output(get_from_list)
number_3 = DoubleInput(1)
get_from_list_2 = GetFromList(number_3, python_script)
Name = Output(get_from_list_2)
number_4 = DoubleInput(2)
get_from_list_3 = GetFromList(number_4, python_script)
Number = Output(get_from_list_3)
number_5 = DoubleInput(3)
get_from_list_4 = GetFromList(number_5, python_script)
Area = Output(get_from_list_4)
number_6 = DoubleInput(4)
get_from_list_5 = GetFromList(number_6, python_script)
Boundaries = Output(get_from_list_5)
number_7 = DoubleInput(5)
get_from_list_6 = GetFromList(number_7, python_script)
Location = Output(get_from_list_6)
number_8 = DoubleInput(6)
get_from_list_7 = GetFromList(number_8, python_script)
Element_ID = Output(get_from_list_7)
number_9 = DoubleInput(7)
get_from_list_8 = GetFromList(number_9, python_script)
Unique_ID = Output(get_from_list_8)
