# Dynamo custom node LunchBox Staggered Grid by Face .dyf "LunchBox Staggered Grid by Face"
# category: LunchBox.Geometry.Panel
# Create a Staggered XYZ grid on a face.  The face surface must have an untrimmed UV parameter space.

Face = Input()
evaluate_uv = XyzEvaluate(arg1=Face, lacing=Longest)
U = Input()
V = Input()
list = NewList(index0=U, index1=V)
python_script = Python(list)
# ---------- python_script.python (90 lines) ----------
#Copyright(c) 2014, Nathan Miller
# The Proving Ground, http://theprovingground.org

# Default imports
import clr
clr.AddReference('RevitAPI')
clr.AddReference('RevitAPIUI')
from Autodesk.Revit.DB import *
import Autodesk

#The input to this node will be stored in the IN variable.
dataEnteringNode = IN

udiv = dataEnteringNode[0]
vdiv = dataEnteringNode[1]

ustep = 1/udiv
vstep = 1/vdiv

quads = []
for i in range(0,int(udiv)):
	for j in range(0,int(vdiv)):
		# Condition 1
		if j%2 == 0:
			ptA = UV(i*ustep,j*vstep)
			ptB = UV((i+1)*ustep,j*vstep)
			ptC = UV((i+1)*ustep,(j+1)*vstep)
			ptD = UV(i*ustep,(j+1)*vstep)
			
			quad = []
			#Append to quad
			quad.append(ptA)
			quad.append(ptB)
			quad.append(ptC)
			quad.append(ptD)
			#Append quads
			quads.append(quad)
			
		# Condition 2
		if j%2 == 1:
			if i < (udiv-1):
				ptA = UV((i+0.5)*ustep,j*vstep)
				ptB = UV((i+1.5)*ustep,j*vstep)
				ptC = UV((i+1.5)*ustep,(j+1)*vstep)
				ptD = UV((i+0.5)*ustep,(j+1)*vstep)
				
				quad = []
				#Append to quad
				quad.append(ptA)
				quad.append(ptB)
				quad.append(ptC)
				quad.append(ptD)
				#Append quads
				quads.append(quad)
			
			# Condition 3
			if i == 0:
				ptA = UV(i*ustep,j*vstep)
				ptB = UV((i+0.5)*ustep,j*vstep)
				ptC = UV((i+0.5)*ustep,(j+1)*vstep)
				ptD = UV(i*ustep,(j+1)*vstep)
			
				quad = []
				#Append to quad
				quad.append(ptA)
				quad.append(ptB)
				quad.append(ptC)
				quad.append(ptD)
				#Append quads
				quads.append(quad)
			
			# Condition 4
			if i == udiv-1:
				ptA = UV((i+0.5)*ustep,j*vstep)
				ptB = UV((i+1)*ustep,j*vstep)
				ptC = UV((i+1)*ustep,(j+1)*vstep)
				ptD = UV((i+0.5)*ustep,(j+1)*vstep)
			
				quad = []
				#Append to quad
				quad.append(ptA)
				quad.append(ptB)
				quad.append(ptC)
				quad.append(ptD)
				#Append quads
				quads.append(quad)


#Assign your output to the OUT variable
OUT = quads
# ----------------------------------------
map = Map(evaluate_uv, python_script)
XYZ = Output(map)
watch = Watch(python_script)
