# Dynamo custom node LunchBox String to XYZ.dyf (Dynamo 0.6.2.2709)
# category: LunchBox.Format
# Converts a point string "x,y,z" into a true Revit XYZ point.

PointString = Input()
python_script = Python(PointString)
# ---------- python_script.python (65 lines) ----------
#Copyright(c) 2014, Nathan Miller
# The Proving Ground, http://theprovingground.org
# Default imports
import clr
clr.AddReference('RevitAPI')
clr.AddReference('RevitAPIUI')
from Autodesk.Revit.DB import *
import Autodesk
import sys
import clr
path = r'C:\Autodesk\Dynamo\Core'
exec_path = r'C:\Autodesk\Dynamo\Core\dll'
sys.path.append(path)
sys.path.append(exec_path)
clr.AddReference('LibGNet')
from Autodesk.LibG import *
import System

#The input to this node will be stored in the IN variable.
ptslist = IN

ptsarr = []

#if the input is an array
if hasattr(ptslist, "__iter__"):

	#if the input is a nested array
	if hasattr(ptslist[0], "__iter__"):
		for i in range(0, len(ptslist)):
			ptstr = ptslist[i]
			pts = []
			for j in range(0,len(ptstr)):
				str = ptstr[j]
				strarr = str.Split(",")
				x = float(strarr[0])
				y = float(strarr[1])
				z = float(strarr[2])
				pt = XYZ(x,y,z)
				pts.append(pt)
			ptsarr.append(pts)
	else:
		for i in range(0,len(ptslist)):
		
			#split string
			str = ptslist[i]
			strarr = str.Split(",")
	
			#compose points
			x = float(strarr[0])
			y = float(strarr[1])
			z = float(strarr[2])
			pt = XYZ(x,y,z)
			ptsarr.append(pt)
else:
	#split string
	str = ptslist
	strarr = str.Split(",")
	x = float(strarr[0])
	y = float(strarr[1])
	z = float(strarr[2])
	pt = XYZ(x,y,z)
	ptsarr.append(pt)

#Assign your output to the OUT variable
OUT = ptsarr
# ----------------------------------------
XYZ = Output(python_script)
