# Dynamo custom node LunchBox Structural Framing Collector.dyf (Dynamo 0.6.3.38253)
# category: LunchBox.Revit.Elements
# Collects Structural Graming Families from the Revit document.

number = DoubleInput(0)
Family_Name = Input()
python_script = Python(Family_Name)
# ---------- python_script.python (67 lines) ----------
#Copyright(c) 2014, Nathan Miller
# The Proving Ground, http://theprovingground.org
# Default imports
import clr
clr.AddReference('RevitAPI')
clr.AddReference('RevitAPIUI')
from Autodesk.Revit.DB import *
import Autodesk
import sys
import clr
path = r'C:\Autodesk\Dynamo\Core'
exec_path = r'C:\Autodesk\Dynamo\Core\dll'
sys.path.append(path)
sys.path.append(exec_path)
clr.AddReference('LibGNet')
from Autodesk.LibG import *

#The input to this node will be stored in the IN variable.

doc = __doc__

famname = IN

collector = FilteredElementCollector(doc)
collector.OfCategory(BuiltInCategory.OST_StructuralFraming)
collector.OfClass(FamilyInstance)
 
famtypeitr = collector.GetElementIdIterator()
famtypeitr.Reset()

output = []
families = []
locations = []
levelnames =[]
structuralmaterials = []
elementids = []
uniqueids = []
for item in famtypeitr:
    famtypeID = item
    faminst = doc.GetElement(famtypeID)
    if faminst.Symbol.Family.Name == famname:
    
    	loc = faminst.Location.Curve
    
    	family = faminst
    
    	levname = faminst.Parameter['Reference Level'].AsValueString()
    	material = faminst.Parameter['Structural Material'].AsValueString()
    	elementid = faminst.Id.ToString()
    	uniqueid = faminst.UniqueId
    	
    	families.append(family)
    	locations.append(loc)
    	levelnames.append(levname)
    	structuralmaterials.append(material)
    	elementids.append(elementid)
    	uniqueids.append(uniqueid)
        
output.append(families)
output.append(locations)
output.append(levelnames)
output.append(structuralmaterials)
output.append(elementids)
output.append(uniqueids)
        
#Assign your output to the OUT variable
OUT = output
# ----------------------------------------
get_from_list = GetFromList(number, python_script)
Element = Output(get_from_list)
number_2 = DoubleInput(1)
get_from_list_2 = GetFromList(number_2, python_script)
Curve = Output(get_from_list_2)
number_3 = DoubleInput(2)
get_from_list_3 = GetFromList(number_3, python_script)
Level_Name = Output(get_from_list_3)
number_4 = DoubleInput(3)
get_from_list_4 = GetFromList(number_4, python_script)
Structural_Material = Output(get_from_list_4)
number_5 = DoubleInput(4)
get_from_list_5 = GetFromList(number_5, python_script)
Element_ID = Output(get_from_list_5)
number_6 = DoubleInput(5)
get_from_list_6 = GetFromList(number_6, python_script)
Unique_ID = Output(get_from_list_6)
