# Dynamo custom node LunchBox Triangle Grid by Face.dyf "LunchBox Triangular Grid by Face"
# category: LunchBox.Geometry.Panel
# Create a Triangular XYZ grid on a face.  The face surface must have an untrimmed UV parameter space.

Face = Input()
evaluate_uv = XyzEvaluate(arg1=Face, lacing=Longest)
U = Input()
V = Input()
list = NewList(index0=U, index1=V)
python_script = Python(list)
# ---------- python_script.python (36 lines) ----------
#Copyright(c) 2014, Nathan Miller
# The Proving Ground, http://theprovingground.org

# Default imports
import clr
clr.AddReference('RevitAPI')
clr.AddReference('RevitAPIUI')
from Autodesk.Revit.DB import *
import Autodesk

#The input to this node will be stored in the IN variable.
dataEnteringNode = IN

udiv = dataEnteringNode[0]
vdiv = dataEnteringNode[1]

ustep = 1/udiv
vstep = 1/vdiv

tris = []
for i in range(0,int(udiv)):
	for j in range(0,int(vdiv)):
		tri = []
		#XYZ Quads
		myXYZA = UV(i*ustep, j*vstep)
		myXYZB = UV((i+1)*ustep,j*vstep)
		myXYZC = UV((i+1)*ustep,(j+1)*vstep)
		#Append to quad
		tri.append(myXYZA)
		tri.append(myXYZB)
		tri.append(myXYZC)
		#Append quads
		tris.append(tri)

#Assign your output to the OUT variable
OUT = tris
# ----------------------------------------
map = Map(evaluate_uv, python_script)
XYZ1 = Output(map)
python_script_2 = Python(list)
# ---------- python_script_2.python (36 lines) ----------
# Nathan Miller, 2013
# The Proving Ground, http://theprovingground.org

# Default imports
import clr
clr.AddReference('RevitAPI')
clr.AddReference('RevitAPIUI')
from Autodesk.Revit.DB import *
import Autodesk

#The input to this node will be stored in the IN variable.
dataEnteringNode = IN

udiv = dataEnteringNode[0]
vdiv = dataEnteringNode[1]

ustep = 1/udiv
vstep = 1/vdiv

tris = []
for i in range(0,int(udiv)):
	for j in range(0,int(vdiv)):
		tri = []
		#XYZ Quads
		myXYZA = UV((i+1)*ustep,(j+1)*vstep)
		myXYZB = UV(i*ustep,(j+1)*vstep)
		myXYZC = UV(i*ustep, j*vstep)
		#Append to quad
		tri.append(myXYZA)
		tri.append(myXYZB)
		tri.append(myXYZC)
		#Append quads
		tris.append(tri)

#Assign your output to the OUT variable
OUT = tris
# ----------------------------------------
map_2 = Map(evaluate_uv, python_script_2)
XYZ2 = Output(map_2)
