# Dynamo custom node LunchBox Wall Element Collector.dyf (Dynamo 0.6.3.38253)
# category: LunchBox.Revit.Elements
# Collects wall elements from the Revit document.

number = DoubleInput(0)
Wall_Type = Input()
python_script = Python(Wall_Type)
# ---------- python_script.python (81 lines) ----------
#Copyright(c) 2014, Nathan Miller
# The Proving Ground, http://theprovingground.org
# Default imports
import clr
clr.AddReference('RevitAPI')
clr.AddReference('RevitAPIUI')
from Autodesk.Revit.DB import *
import Autodesk
import sys
import clr
path = r'C:\Autodesk\Dynamo\Core'
exec_path = r'C:\Autodesk\Dynamo\Core\dll'
sys.path.append(path)
sys.path.append(exec_path)
clr.AddReference('LibGNet')
from Autodesk.LibG import *

#The input to this node will be stored in the IN variable.

doc = __doc__

walltype = IN

collector = FilteredElementCollector(doc)
collector.OfCategory(BuiltInCategory.OST_Walls)
collector.OfClass(Wall)
 
famtypeitr = collector.GetElementIdIterator()
famtypeitr.Reset()

output = []
walls = []
locations = []
heights = []
levelnames =[]
elementids = []
uniqueids = []
for item in famtypeitr:
    famtypeID = item
    faminst = doc.GetElement(famtypeID)
    
    if walltype == '*':
    	loc = faminst.Location.Curve
    	wall = faminst
    
    	levname = faminst.Parameter['Base Constraint'].AsValueString()
    	height = faminst.Parameter['Unconnected Height'].AsDouble()
    	elementid = faminst.Id.ToString()
    	uniqueid = faminst.UniqueId
    	
    	walls.append(wall)
    	locations.append(loc)
    	heights.append(height)
    	levelnames.append(levname)
    	elementids.append(elementid)
    	uniqueids.append(uniqueid)    
    elif faminst.WallType.Id == walltype.Id:
    	loc = faminst.Location.Curve
    	wall = faminst
    
    	levname = faminst.Parameter['Base Constraint'].AsValueString()
    	height = faminst.Parameter['Unconnected Height'].AsDouble()
    	elementid = faminst.Id.ToString()
    	uniqueid = faminst.UniqueId
    	
    	walls.append(wall)
    	locations.append(loc)
    	heights.append(height)
    	levelnames.append(levname)
    	elementids.append(elementid)
    	uniqueids.append(uniqueid)
        
output.append(walls)
output.append(locations)
output.append(heights)
output.append(levelnames)
output.append(elementids)
output.append(uniqueids)
        
#Assign your output to the OUT variable
OUT = output
# ----------------------------------------
get_from_list = GetFromList(number, python_script)
Wall_Element = Output(get_from_list)
solid_from_element = ElementSolid(get_from_list, lacing=Longest)
Solid = Output(solid_from_element)
number_2 = DoubleInput(1)
get_from_list_2 = GetFromList(number_2, python_script)
Location_Curve = Output(get_from_list_2)
number_3 = DoubleInput(2)
get_from_list_3 = GetFromList(number_3, python_script)
Height = Output(get_from_list_3)
number_4 = DoubleInput(3)
get_from_list_4 = GetFromList(number_4, python_script)
Level = Output(get_from_list_4)
number_5 = DoubleInput(4)
get_from_list_5 = GetFromList(number_5, python_script)
Element_ID = Output(get_from_list_5)
number_6 = DoubleInput(5)
get_from_list_6 = GetFromList(number_6, python_script)
Unique_ID = Output(get_from_list_6)
