# Dynamo custom node LunchBox XYZ Amplitude.dyf (Dynamo 0.6.3.38253)
# category: LunchBox.Geometry.Vector
# Set the amplitude of an XYZ (vector)

XYZ = Input()
unitize_xyz = XyzNormalize(XYZ, lacing=Longest)
xyz_components = XyzComponents(unitize_xyz, lacing=Longest)
Amplitude = Input()
multiply = Multiplication(xyz_components.out0, Amplitude, lacing=Longest)
multiply_2 = Multiplication(xyz_components.out1, Amplitude, lacing=Longest)
multiply_3 = Multiplication(xyz_components.out2, Amplitude, lacing=Longest)
XYZ_2 = Xyz(multiply, multiply_2, multiply_3, lacing=Longest)
XYZ_3 = Output(XYZ_2)  # "XYZ"
