# Dynamo custom node LunchBox XYZ Angle.dyf (Dynamo 0.6.3.38253)
# category: LunchBox.Geometry.Vector
# Computes the angle between two XYZ vectors.

XYZ1 = Input()
XYZ2 = Input()
list = NewList(index0=XYZ1, index1=XYZ2)
python_script = Python(list)
# ---------- python_script.python (55 lines) ----------
#Copyright(c) 2014, Nathan Miller
#TheProvingGround.org

# Default imports
import clr
clr.AddReference('RevitAPI')
clr.AddReference('RevitAPIUI')
from Autodesk.Revit.DB import *
import Autodesk
import sys
import clr
path = r'C:\Autodesk\Dynamo\Core'
exec_path = r'C:\Autodesk\Dynamo\Core\dll'
sys.path.append(path)
sys.path.append(exec_path)
clr.AddReference('LibGNet')
from Autodesk.LibG import *

#The input to this node will be stored in the IN variable.
vecA = IN[0]
vecB = IN[1]

testA = hasattr(vecA, "__iter__")
testB = hasattr(vecB, "__iter__")

bools = testA + testB

angles = []

#if the input is an array
if bools>0:
	if bools == 2:
		for i in range(0,len(vecA)):
			angle = []
			for j in range(0,len(vecB)):
				a = vecA[i].AngleTo(vecB[j])
				angle.append(a)
			angles.append(angle)
	
	elif hasattr(vecA, "__iter__"):
		for i in range(0,len(vecA)):
			a = vecA[i].AngleTo(vecB)
			angles.append(a)
		
	elif hasattr(vecB, "__iter__"):
		angle = []
		for i in range(0,len(vecB)):
			a = vecA.AngleTo(vecB[i])
			angles.append(a)
else:
	angle = vecA.AngleTo(vecB)
	angles.append(angle)

#Assign your output to the OUT variable
OUT = angles
# ----------------------------------------
Angle = Output(python_script)
