# Dynamo custom node LunchBox XYZ to String.dyf (Dynamo 0.6.2.29585)
# category: LunchBox.Format
# Converts XYZ objects to strings.

XYZ = Input()
python_script = Python(XYZ)
# ---------- python_script.python (58 lines) ----------
#Copyright(c) 2014, Nathan Miller
# The Proving Ground, http://theprovingground.org
# Default imports
import clr
clr.AddReference('RevitAPI')
clr.AddReference('RevitAPIUI')
from Autodesk.Revit.DB import *
import Autodesk
import sys
import clr
path = r'C:\Autodesk\Dynamo\Core'
exec_path = r'C:\Autodesk\Dynamo\Core\dll'
sys.path.append(path)
sys.path.append(exec_path)
clr.AddReference('LibGNet')
from Autodesk.LibG import *


#The input to this node will be stored in the IN variable.
ptslist = IN

ptsarr = []

#if the input is an array
if hasattr(ptslist, "__iter__"):

	#if the input is a nested array
	if hasattr(ptslist[0], "__iter__"):
		for i in range(0, len(ptslist)):
			ptstr = ptslist[i]
			pts = []
			for j in range(0,len(ptstr)):
				pt = ptstr[j]
				x = str(pt.X)
				y = str(pt.Y)
				z = str(pt.Z)
				pt = x + ',' + y + ',' + z
				pts.append(pt)
			ptsarr.append(pts)
	else:
		for i in range(0,len(ptslist)):
		
			pt = ptslist[i]
			x = str(pt.X)
			y = str(pt.Y)
			z = str(pt.Z)
			pt = x + ',' + y + ',' + z
			ptsarr.append(pt)
else:
	pt = ptslist
	x = str(pt.X)
	y = str(pt.Y)
	z = str(pt.Z)
	pt = x + ',' + y + ',' + z
	ptsarr.append(pt)

#Assign your output to the OUT variable
OUT = ptsarr
# ----------------------------------------
PointString = Output(python_script)
