# Dynamo custom node MaxMinPointsByDirection.dyf (Dynamo 0.7.0.26247)
# category: EPR
# Get the max and min point of a curve following a direction pointed by a straight line.

Dir_Line = Input()
Curve = Input()
get_point_in_the_side_of_the_end = CodeBlock(Dir_Line, Curve) { PlanePerp2=Plane.ByOriginNormal(LineD.EndPoint,LineD.Direction); PointMax=CurveBase.GetClosestPoint(PlanePerp2); }  # "Get Point in the side of the end of LineD"
Max_Point = Output(get_point_in_the_side_of_the_end.PointMax)
get_point_in_the_side_of_the = CodeBlock(Dir_Line, Curve) { PlanePerp1=Plane.ByOriginNormal(LineD.StartPoint,LineD.Direction); PointMax=CurveBase.GetClosestPoint(PlanePerp1); }  # "Get Point in the side of the start of LineD"
Min_Point = Output(get_point_in_the_side_of_the.PointMax)
