# Dynamo custom node Minimum Distance between collection points.dyf (Dynamo 0.6.2.22517)
# category: Geometry.Point.Query

xyz_list_A = Input()
xyz_list_B = Input()
xyz_distance = XyzDistance(xyz_list_A, xyz_list_B, lacing=CrossProduct)
dist_list = Output(xyz_distance)
sort = Sort()
map = Map(sort, xyz_distance)
sort_dist_list = Output(map)
first_of_list = First()
map_2 = Map(first_of_list, map)
min_dist_list = Output(map_2)
