# Dynamo custom node Mirror Image to Wall Correctly.dyf (Dynamo 0.6.3.7993)
# category: CEE220C
# Takes an image, Mirrors it properly on a wall

List_image_to_Mirror_Properly = Input()  # "List (image) to Mirror Properly"
Number_of_Elements_in_Each_Row = Input()
partition_list = Slice(List_image_to_Mirror_Properly, Number_of_Elements_in_Each_Row)
reverse = Reverse(partition_list)
transpose_lists = Transpose(reverse)
reverse_2 = Reverse(transpose_lists)
flatten_completely = FlattenList(reverse_2)
reverse_3 = Reverse(flatten_completely)
partition_list_2 = Slice(reverse_3, Number_of_Elements_in_Each_Row)
transpose_lists_2 = Transpose(partition_list_2)
reverse_4 = Reverse(transpose_lists_2)
flatten_completely_2 = FlattenList(reverse_4)
partition_list_3 = Slice(flatten_completely_2, Number_of_Elements_in_Each_Row)
reverse_5 = Reverse(partition_list_3)
transpose_lists_3 = Transpose(reverse_5)
reverse_6 = Reverse(transpose_lists_3)
flatten_completely_3 = FlattenList(reverse_6)
List = Output(flatten_completely_3)
