# Dynamo custom node Add To Collection.dyf (Dynamo 0.6.3.25815)
# category: Collections.NamedCollection
# Sets a key equal to a value inside collection

Collection = Input()
Key = Input()
Value = Input()
python_script_with_variable = Python(Collection, Key, Value)  # "Python Script With Variable Number of Inputs"
# ---------- python_script_with_variable.python (34 lines) ----------
# Default imports
import clr
clr.AddReference('RevitAPI')
clr.AddReference('RevitAPIUI')
from Autodesk.Revit.DB import *
import Autodesk
import sys
import clr
path = r'C:\Autodesk\Dynamo\Core'
exec_path = r'C:\Autodesk\Dynamo\Core\dll'
sys.path.append(path)
sys.path.append(exec_path)
clr.AddReference('LibGNet')
from Autodesk.LibG import *
sys.path.append(r'C:\Program Files (x86)\IronPython 2.7\Lib')
import copy

collection = IN0
key = IN1
value = IN2




collection2 = copy.deepcopy(collection)

collection2.dict[key] = value





#Assign your output to the OUT variable
OUT = collection2
# ----------------------------------------
Collection_2 = Output(python_script_with_variable)  # "Collection"
