# Dynamo custom node Collection From Python Dictionary.dyf (Dynamo 0.6.3.14437)
# category: Collections.NamedCollection
# Converts a python dictionary to a named collection

Collection_Name = Input()
dictionary = Input()
python_script_with_variable = Python(Collection_Name, dictionary)  # "Python Script With Variable Number of Inputs"
# ---------- python_script_with_variable.python (39 lines) ----------
# Default imports
import clr
clr.AddReference('RevitAPI')
clr.AddReference('RevitAPIUI')
from Autodesk.Revit.DB import *
import Autodesk
import sys
import clr
path = r'C:\Autodesk\Dynamo\Core'
exec_path = r'C:\Autodesk\Dynamo\Core\dll'
sys.path.append(path)
sys.path.append(exec_path)
clr.AddReference('LibGNet')
from Autodesk.LibG import *
sys.path.append(r'C:\Program Files (x86)\IronPython 2.7\Lib')
import copy
#The input to this node will be stored in the IN0...INX variable(s).

class collection():
	def __init__(self,name,key,value):
		self.name = name
		self.dict = {}
		self.dict[key] = value
	def __str__(self):
		x = str(self.name) + " collection"
		for key,value in self.dict.iteritems():
			x = x + '\n'+ '  %s= %s ' % (key, value)
		return x		

type= IN0
key = None
value = None
dictold = IN1

newcol = collection(type,key,value)
newcol.dict = dictold

#Assign your output to the OUT variable
OUT = newcol
# ----------------------------------------
collection = Output(python_script_with_variable)
