# Dynamo custom node Create Collection.dyf (Dynamo 0.6.3.25815)
# category: Collections.NamedCollection
# Creates a named dictionary object

Collection_Name = Input()
Key = Input()
Value = Input()
python_script_with_variable = Python(Collection_Name, Key, Value)  # "Python Script With Variable Number of Inputs"
# ---------- python_script_with_variable.python (38 lines) ----------
# Default imports
import clr
clr.AddReference('RevitAPI')
clr.AddReference('RevitAPIUI')
from Autodesk.Revit.DB import *
import Autodesk
import sys
import clr
path = r'C:\Autodesk\Dynamo\Core'
exec_path = r'C:\Autodesk\Dynamo\Core\dll'
sys.path.append(path)
sys.path.append(exec_path)
clr.AddReference('LibGNet')
from Autodesk.LibG import *
sys.path.append(r'C:\Program Files (x86)\IronPython 2.7\Lib')
import copy
#The input to this node will be stored in the IN0...INX variable(s).

class collection():
	def __init__(self,name,key,value):
		self.name = name
		self.dict = {}
		self.dict[key] = value
	def __str__(self):
		x = str(self.name) + " collection"
		for key,value in self.dict.iteritems():
			x = x + '\n'+ '  %s= %s ' % (key, value)
		return x		

type= IN0
key = IN1
value = IN2

newcol = collection(type,key,value)


#Assign your output to the OUT variable
OUT = newcol
# ----------------------------------------
collection = Output(python_script_with_variable)
