# Dynamo custom node Get Collection Keys.dyf (Dynamo 0.6.3.25815)
# category: Collections.NamedCollection
# Gets all keys from a collection

Collection = Input()
python_script_with_variable = Python(Collection)  # "Python Script With Variable Number of Inputs"
# ---------- python_script_with_variable.python (28 lines) ----------
# Default imports
import clr
clr.AddReference('RevitAPI')
clr.AddReference('RevitAPIUI')
from Autodesk.Revit.DB import *
import Autodesk
import sys
import clr
path = r'C:\Autodesk\Dynamo\Core'
exec_path = r'C:\Autodesk\Dynamo\Core\dll'
sys.path.append(path)
sys.path.append(exec_path)
clr.AddReference('LibGNet')
from Autodesk.LibG import *



#The input to this node will be stored in the IN0...INX variable(s).
collection = IN0

x=[]

for key in collection.dict.iterkeys():
	x.append(key)


#Assign your output to the OUT variable
OUT = x
# ----------------------------------------
Keys = Output(python_script_with_variable)
