# Dynamo custom node Get Collection Name.dyf (Dynamo 0.6.3.25815)
# category: Collections.NamedCollection
# Gets the name of a collection

collection = Input()
python_script = Python(collection)
# ---------- python_script.python (20 lines) ----------
# Default imports
import clr
clr.AddReference('RevitAPI')
clr.AddReference('RevitAPIUI')
from Autodesk.Revit.DB import *
import Autodesk
import sys
import clr
path = r'C:\Autodesk\Dynamo\Core'
exec_path = r'C:\Autodesk\Dynamo\Core\dll'
sys.path.append(path)
sys.path.append(exec_path)
clr.AddReference('LibGNet')
from Autodesk.LibG import *

#The input to this node will be stored in the IN variable.
collection = IN

name = collection.name
OUT = name
# ----------------------------------------
name = Output(python_script)
