# Dynamo custom node Get Item From Collection At Key.dyf (Dynamo 0.6.3.25815)
# category: Collections.NamedCollection
# Gets an item from a collection at key

Collection = Input()
Key = Input()
python_script_with_variable = Python(Collection, Key)  # "Python Script With Variable Number of Inputs"
# ---------- python_script_with_variable.python (33 lines) ----------
# Default imports
import clr
clr.AddReference('RevitAPI')
clr.AddReference('RevitAPIUI')
from Autodesk.Revit.DB import *
import Autodesk
import sys
import clr
path = r'C:\Autodesk\Dynamo\Core'
exec_path = r'C:\Autodesk\Dynamo\Core\dll'
sys.path.append(path)
sys.path.append(exec_path)
clr.AddReference('LibGNet')
from Autodesk.LibG import *

dict = {}



collection = IN0
key = IN1

if key in collection.dict:
	data = collection.dict[key]
else:
	data = "Key Not Found"





#Assign your output to the OUT variable
OUT = data
# ----------------------------------------
Value = Output(python_script_with_variable)
