# Dynamo custom node Remove Key From Collection.dyf (Dynamo 0.6.3.25815)
# category: Collections.NamedCollection
# Removes a key from a collection

number = DoubleInput(0)
Collection = Input()
Key = Input()
python_script_with_variable = Python(Collection, Key)  # "Python Script With Variable Number of Inputs"
# ---------- python_script_with_variable.python (26 lines) ----------
# Default imports
import clr
clr.AddReference('RevitAPI')
clr.AddReference('RevitAPIUI')
from Autodesk.Revit.DB import *
import Autodesk
import sys
import clr
path = r'C:\Autodesk\Dynamo\Core'
exec_path = r'C:\Autodesk\Dynamo\Core\dll'
sys.path.append(path)
sys.path.append(exec_path)
clr.AddReference('LibGNet')
from Autodesk.LibG import *
sys.path.append(r'C:\Program Files (x86)\IronPython 2.7\Lib')
import copy
#The input to this node will be stored in the IN0...INX variable(s).
collection = IN0
key = IN1
collection2 = copy.deepcopy(collection)
val = collection2.dict.pop(key, None)

OUT = []

OUT.append(collection2)
OUT.append(val)
# ----------------------------------------
get_from_list = GetFromList(number, python_script_with_variable)
modified_collection = Output(get_from_list)
number_2 = DoubleInput(1)
get_from_list_2 = GetFromList(number_2, python_script_with_variable)
value_removed_at_key = Output(get_from_list_2)
