# Dynamo custom node Normalize Value.dyf (Dynamo 0.6.2.279)
# category: CAAD_RWTH.Math
# Converts a value into a normalized value according to a value range

val = Input()
Min = Input()
Max = Input()
formula = Formula("(x-min)/(max-min)", x=val, min=Min, max=Max, lacing=Longest)
