# Dynamo custom node Scale Normalized Value.dyf (Dynamo 0.6.2.279)
# category: CAAD_RWTH.Math
# Scales a normalized value according to a given minimum and maximum

Min = Input()
Max = Input()
val = Input()
formula = Formula("min+(max-min)*value", min=Min, max=Max, value=val, lacing=Longest)
