# Dynamo custom node Numbering Sequence with Skip.dyf (Dynamo 0.6.3.7993)
# category: Archi-lab.Strings
# Creates a numbering sequence of given length, starting at a given number and skipping a given number. If sequence starting at single digits it will force two leading zeros and convert number to string.

Length = Input()
Start = Input()
Skip = Input()
python_script_with_variable = Python(Length, Start, Skip)  # "Python Script With Variable Number of Inputs"
# ---------- python_script_with_variable.python (33 lines) ----------
# Default imports
import clr
clr.AddReference('RevitAPI')
clr.AddReference('RevitAPIUI')
from Autodesk.Revit.DB import *
import Autodesk
import sys
import clr
path = r'C:\Autodesk\Dynamo\Core'
exec_path = r'C:\Autodesk\Dynamo\Core\dll'
sys.path.append(path)
sys.path.append(exec_path)
clr.AddReference('LibGNet')
from Autodesk.LibG import *

#The input to this node will be stored in the IN0...INX variable(s).
dataEnteringNode = IN0
lstLength = IN0
skipNum = IN2

import itertools
lst = []
count = int(IN1)
while len(lst) < lstLength:
	count +=1
	if count % 10 == skipNum:
		continue
	countFormat = str(count).zfill(3)
	lst.append(countFormat)


#define outputs
OUT = lst
# ----------------------------------------
Sequence = Output(python_script_with_variable)
