# Dynamo custom node Override Element SurfacePattern_Transparency_Halftone.dyf (Dynamo 0.6.3.7993)
# category: JBE
# Overrides surface pattern of elements, with color, transparency and halftone settings

revit_document = RevitDocument(lacing=Longest)
element_types = ElementTypes(index=103)
all_elements_of_type = AllElementsOfType(element_types)
Pattern_Name_as_jocker = Input()  # "Pattern Name (* as jocker)"
get_name = Custom[Get Name](element_s=all_elements_of_type)  # Gets the name of a given Revit element (if possible)
match_regular_expression = Custom[Match Regular Expression](regex=Pattern_Name_as_jocker, string_s=get_name)  # Determines if a regular expression matches a string (or a list of strings) and returns a boolean value (or a list, depending on the input). The syntax for regular expressions is explained at http://ironpython-test.readthedocs.org/en/latest/howto/regex.html
filter_by_boolean_mask = FilterMask(all_elements_of_type, match_regular_expression)
elements_to_ids = Custom[Elements to IDs](Element_s=filter_by_boolean_mask)  # Gets the ID(s) for a list of Revit elements (or a single element)
Elements = Input()
turn_into_list = Custom[Turn Into List](item=Elements)  # Turns an element into a (flat) list
Set_transparency_boolean = Input()  # "Set transparency (boolean)"
Transparency_amount_0_100 = Input()  # "Transparency amount 0-100"
Set_Halftone_boolean = Input()  # "Set Halftone (boolean)"
python_script_with_variable = Python(revit_document, elements_to_ids.ID_s, turn_into_list, arg6=Set_transparency_boolean, arg7=Transparency_amount_0_100, arg8=Set_Halftone_boolean)  # "Python Script With Variable Number of Inputs"
# ---------- python_script_with_variable.python (41 lines) ----------
# Default imports
import clr
clr.AddReference('RevitAPI')
clr.AddReference('RevitAPIUI')
from Autodesk.Revit.DB import *
import Autodesk
import sys
import clr
path = r'C:\Autodesk\Dynamo\Core'
exec_path = r'C:\Autodesk\Dynamo\Core\dll'
sys.path.append(path)
sys.path.append(exec_path)
clr.AddReference('LibGNet')
from Autodesk.LibG import *

doc = IN0
pattern = IN1
element = IN2
R=IN3
G=IN4
B=IN5
transparency=IN6
amount=IN7
halftone=IN8

elementlist = []

color = Autodesk.Revit.DB.Color(R,G,B)

a=OverrideGraphicSettings().SetProjectionFillPatternId(pattern)
b=OverrideGraphicSettings(a).SetProjectionFillColor(color)
c=OverrideGraphicSettings(b).SetSurfaceTransparency(amount)
d=OverrideGraphicSettings(c).SetHalftone(halftone)

for item in element:
	A=doc.ActiveView.SetElementOverrides(item.Id, a)
	B=doc.ActiveView.SetElementOverrides(item.Id, b)
	C=doc.ActiveView.SetElementOverrides(item.Id, c)
	D=doc.ActiveView.SetElementOverrides(item.Id, d)

OUT =0
# ----------------------------------------
R = Input(R: list of values 0-255)
list_length = Length(turn_into_list)
turn_into_list_2 = Custom[Turn Into List](item=R)
list_length_2 = Length(turn_into_list_2)
divide = Division(list_length, list_length_2, lacing=Longest)
round = Round(divide, lacing=Longest)
number = DoubleInput(1)
add = Addition(round, number, lacing=Longest)
repeat = Repeat(R, add)
flatten_completely = FlattenList(repeat)
return_list_or_single_value = Custom[Return List Or Single Value](list_1=Elements, list_2=flatten_completely)  # If the list in input #1 has only one item, only the first item of the list in input #2 will be returned.
G = Input(G: list of values 0-255)
turn_into_list_3 = Custom[Turn Into List](item=G)
list_length_3 = Length(turn_into_list_3)
divide_2 = Division(list_length, list_length_3, lacing=Longest)
round_2 = Round(divide_2, lacing=Longest)
number_2 = DoubleInput(1)
add_2 = Addition(round_2, number_2, lacing=Longest)
repeat_2 = Repeat(G, add_2)
flatten_completely_2 = FlattenList(repeat_2)
return_list_or_single_value_2 = Custom[Return List Or Single Value](list_1=Elements, list_2=flatten_completely_2)
B = Input(B: list of values 0-255)
turn_into_list_4 = Custom[Turn Into List](item=B)
list_length_4 = Length(turn_into_list_4)
divide_3 = Division(list_length, list_length_4, lacing=Longest)
round_3 = Round(divide_3, lacing=Longest)
number_3 = DoubleInput(1)
add_3 = Addition(round_3, number_3, lacing=Longest)
repeat_3 = Repeat(B, add_3)
flatten_completely_3 = FlattenList(repeat_3)
return_list_or_single_value_3 = Custom[Return List Or Single Value](list_1=Elements, list_2=flatten_completely_3)
combine = Combine(python_script_with_variable, return_list_or_single_value, return_list_or_single_value_2, return_list_or_single_value_3)
Elements_IDs = Output(combine)
watch = Watch(filter_by_boolean_mask)
watch_2 = Watch(combine)
