# Dynamo custom node Physical Beam to Analytical.dyf (Dynamo 0.6.3.7993)
# category: JBE
# Moves a beam instance to his analytical model location

Analytical_Beam = Input()
turn_into_list = Custom[Turn Into List](item=Analytical_Beam)  # Turns an element into a (flat) list
python_script = Python(turn_into_list)
# ---------- python_script.python (25 lines) ----------
# Default imports
import clr
clr.AddReference('RevitAPI')
clr.AddReference('RevitAPIUI')
from Autodesk.Revit.DB import *
import Autodesk
import sys
import clr
path = r'C:\Autodesk\Dynamo\Core'
exec_path = r'C:\Autodesk\Dynamo\Core\dll'
sys.path.append(path)
sys.path.append(exec_path)
clr.AddReference('LibGNet')
from Autodesk.LibG import *

element = IN
start=[]
end=[]
for item in element:
	b=item.GetCurve().GetEndPoint(0)
	c=item.GetCurve().GetEndPoint(1)
	start.append(b)
	end.append(c)
	
OUT= b,c
# ----------------------------------------
transaction = Transaction(python_script)
revit_document = RevitDocument(lacing=Longest)
Physical_beam = Input()
turn_into_list_2 = Custom[Turn Into List](item=Physical_beam)
first_of_list = First(transaction)
rest_of_list = Rest(transaction)
line_by_endpoints = LineBound(first_of_list, rest_of_list, lacing=Longest)
python_script_with_variable = Python(revit_document, turn_into_list_2, line_by_endpoints)  # "Python Script With Variable Number of Inputs"
# ---------- python_script_with_variable.python (27 lines) ----------
# Default imports
import clr
clr.AddReference('RevitAPI')
clr.AddReference('RevitAPIUI')
from Autodesk.Revit.DB import *
import Autodesk
import sys
import clr
path = r'C:\Autodesk\Dynamo\Core'
exec_path = r'C:\Autodesk\Dynamo\Core\dll'
sys.path.append(path)
sys.path.append(exec_path)
clr.AddReference('LibGNet')
from Autodesk.LibG import *

doc = IN0
element = IN1
line = IN2


for item in element:
	a=item.Location

for item in line:
	a.Curve=item

OUT= 0
# ----------------------------------------
transaction_2 = Transaction(python_script_with_variable)
reset_manual_adjustment = Python(turn_into_list)
# ---------- reset_manual_adjustment.python (21 lines) ----------
# Default imports
import clr
clr.AddReference('RevitAPI')
clr.AddReference('RevitAPIUI')
from Autodesk.Revit.DB import *
import Autodesk
import sys
import clr
path = r'C:\Autodesk\Dynamo\Core'
exec_path = r'C:\Autodesk\Dynamo\Core\dll'
sys.path.append(path)
sys.path.append(exec_path)
clr.AddReference('LibGNet')
from Autodesk.LibG import *

#The input to this node will be stored in the IN variable.
element = IN
for item in element:
		a=item.ResetManualAdjustment()
#Assign your output to the OUT variable
OUT = a
# ----------------------------------------
transaction_3 = Transaction(reset_manual_adjustment)
perform_all = Begin(expr1=transaction, expr2=transaction_2, expr3=transaction_3)
Output = Output(perform_all)  # ""
