# Dynamo custom node Place Group at XYZ.dyf (Dynamo 0.6.3.7993)
# category: JBE
# place a given group at a XYZ location

revit_document = RevitDocument(lacing=Longest)
XYZs = Input()
python_script_with_variable = Python(revit_document, arg2=XYZs)  # "Python Script With Variable Number of Inputs"
# ---------- python_script_with_variable.python (25 lines) ----------
# Default imports
import clr
clr.AddReference('RevitAPI')
clr.AddReference('RevitAPIUI')
from Autodesk.Revit.DB import *
import Autodesk
import sys
import clr
path = r'C:\Autodesk\Dynamo\Core'
exec_path = r'C:\Autodesk\Dynamo\Core\dll'
sys.path.append(path)
sys.path.append(exec_path)
clr.AddReference('LibGNet')
from Autodesk.LibG import *

#The input to this node will be stored in the IN0...INX variable(s).
doc=IN0
grptype = IN1
xyz=IN2

for item in xyz:
	b=doc.Create.PlaceGroup(item,IN1)
	

OUT = IN1
# ----------------------------------------
element_types = ElementTypes(index=121)
all_elements_of_type = AllElementsOfType(element_types)
Group_Name_as_String_as_jocker = Input()  # "Group Name as String(* as jocker)"
get_name = Custom[Get Name](element_s=all_elements_of_type)  # Gets the name of a given Revit element (if possible)
match_regular_expression = Custom[Match Regular Expression](regex=Group_Name_as_String_as_jocker, string_s=get_name)  # Determines if a regular expression matches a string (or a list of strings) and returns a boolean value (or a list, depending on the input). The syntax for regular expressions is explained at http://ironpython-test.readthedocs.org/en/latest/howto/regex.html
turn_into_list = Custom[Turn Into List](item=match_regular_expression)  # Turns an element into a (flat) list
filter_by_boolean_mask = FilterMask(all_elements_of_type, turn_into_list)
map = Map(python_script_with_variable, filter_by_boolean_mask)
transaction = Transaction(map)
Output = Output(transaction)  # ""
