# Dynamo custom node Plane From First 3 XYZs.dyf (Dynamo 0.6.2.39994)
# category: CAAD_RWTH.XYZ
# Returns a plane, its origin and its normal based on the first three XYZs in a given list

formula = Formula("3", lacing=Longest)
list = Input()
take_from_list = TakeList(formula, list)
best_fit_plane = BestFitPlane(take_from_list, lacing=Longest)
