# Dynamo custom node Project To XY Plane.dyf "Project XYZ To XY Plane"
# category: Create Geometry.Point
# Given an XYZ, make the Z value 0 - effectively projecting the XYZ to the XY plane.

xyz = Input()
xyz_x = XYZGetX(xyz, lacing=Longest)
xyz_y = XYZGetY(xyz, lacing=Longest)
number = DoubleInput(0)
XYZ = XYZ(xyz_x, xyz_y, number, lacing=Longest)
