# Dynamo custom node Project XYZ To XZ Plane.dyf
# category: Create Geometry.Point
# Projects an XYZ to the XZ plane, zeroing out its Y coordinate.

xyz = Input()
xyz_x = XyzGetX(xyz, lacing=Longest)
number = DoubleInput(0)
xyz_z = XyzGetZ(xyz, lacing=Longest)
XYZ = Xyz(xyz_x, number, xyz_z, lacing=Longest)
