# Dynamo custom node Project XYZ to YZ Plane.dyf
# category: Create Geometry.Point
# Zeros out the X coordinate of the XYZ.

number = DoubleInput(0)
xyz = Input()
xyz_y = XyzGetY(xyz, lacing=Longest)
xyz_z = XyzGetZ(xyz, lacing=Longest)
XYZ = Xyz(number, xyz_y, xyz_z, lacing=Longest)
