# Dynamo custom node Purge Line Pattern.dyf (Dynamo 0.6.3.7993)
# category: JBE
# purge line patterns from document by a string key

revit_document = RevitDocument(lacing=Longest)
revit_document_2 = RevitDocument(lacing=Longest)
transaction = Transaction(revit_document_2)
python_script_with_variable = Python(transaction)  # "Python Script With Variable Number of Inputs"
# ---------- python_script_with_variable.python (12 lines) ----------
import clr
clr.AddReference('RevitAPI')
clr.AddReference('RevitAPIUI')
from Autodesk.Revit.DB import *
import Autodesk

doc = IN0

collector = FilteredElementCollector(doc)
filter = collector.OfClass(LinePatternElement).ToElements()

OUT=filter
# ----------------------------------------
String_Regex = Input()  # "String(Regex)"
get_name = Custom[Get Name](element_s=python_script_with_variable)  # Gets the name of a given Revit element (if possible)
match_regular_expression = Custom[Match Regular Expression](regex=String_Regex, string_s=get_name)  # Determines if a regular expression matches a string (or a list of strings) and returns a boolean value (or a list, depending on the input). The syntax for regular expressions is explained at http://ironpython-test.readthedocs.org/en/latest/howto/regex.html
filter_by_boolean_mask = FilterMask(python_script_with_variable, match_regular_expression)
python_script_with_variable_2 = Python(revit_document, filter_by_boolean_mask)  # "Python Script With Variable Number of Inputs"
# ---------- python_script_with_variable_2.python (13 lines) ----------
import clr
clr.AddReference('RevitAPI')
clr.AddReference('RevitAPIUI')
from Autodesk.Revit.DB import *
import Autodesk

doc = IN0
x = IN1

for item in x:
	doc.Delete(item)

OUT=0
# ----------------------------------------
transaction_2 = Transaction(python_script_with_variable_2)
Output = Output(transaction_2)  # ""
