# Dynamo custom node Cathetus By Pythagoras.dyf (Dynamo 0.6.3.5260)
# category: CAAD_RWTH.Math.Formulas
# Computes the length of one of the catheti / legs of a right triangle using the Pythagorean Theorem. B is the other leg / cathetus of the triangle while C is the hypotenuse.

C = Input()
B = Input()
formula = Formula("Sqrt(Pow(c,2)-Pow(b,2))", c=C, b=B, lacing=Longest)
A = Output(formula)
