# Dynamo custom node Quad Deflection.dyf (Dynamo 0.6.2.29585)
# category: buildz
# Measures the centerpoint deflection in a quadrilateral

number = DoubleInput(0.5)
number_2 = DoubleInput(0)
get_from_list = GetFromList(number_2)
Quad_XYZs = Input()
map = Map(get_from_list, Quad_XYZs)
number_3 = DoubleInput(2)
get_from_list_2 = GetFromList(number_3)
map_2 = Map(get_from_list_2, Quad_XYZs)
line_by_endpoints = LineBound(map, map_2, lacing=Longest)
evaluate_curve = XyzOnCurveOrEdge(number, line_by_endpoints, lacing=Longest)
number_4 = DoubleInput(0.5)
number_5 = DoubleInput(1)
get_from_list_3 = GetFromList(number_5)
map_3 = Map(get_from_list_3, Quad_XYZs)
number_6 = DoubleInput(3)
get_from_list_4 = GetFromList(number_6)
map_4 = Map(get_from_list_4, Quad_XYZs)
line_by_endpoints_2 = LineBound(map_3, map_4, lacing=Longest)
evaluate_curve_2 = XyzOnCurveOrEdge(number_4, line_by_endpoints_2, lacing=Longest)
xyz_distance = XyzDistance(evaluate_curve, evaluate_curve_2, lacing=Longest)
Deflection = Output(xyz_distance)
