# Dynamo custom node Quad Points on Face.dyf (Dynamo 0.6.2.29585)
# category: buildz
# Creates a regular grid of points on a face in quad groups

V_count = Input()  # "V-count"
face = Input()
get_surface_domain = SurfaceDomain(face, lacing=Longest)
U_count = Input()  # "U-count"
uv_grid = UvGrid(get_surface_domain, U_count, V_count)
evaluate_surface = XyzEvaluate(uv_grid, face, lacing=Longest)
quads_from_rectangular_grid = Custom[Quads from Rectangular Grid](Row_Number=V_count, Point_List=evaluate_surface)  # Given a grid of points (xyz or uv) create a list of quadrilaterals
