# Dynamo custom node Quads from Rectangular Grid.dyf
# category: buildz
# Given a grid of points (xyz or uv) create a list of quadrilaterals

Point_List = Input()
Row_Number = Input()
formula = Formula("x+1", x=Row_Number, lacing=Longest)
formula_2 = Formula("x-1", x=Row_Number, lacing=Longest)
# note: Create lists of corner points
build_sublists = Sublists("0..x", Point_List, formula, formula_2, lacing=Longest)
# note: Drop First Row
rest_of_list = Rest(build_sublists)
flatten_completely = FlattenList(rest_of_list)
# note: Drop Last Row
reverse = Reverse(build_sublists)
rest_of_list_2 = Rest(reverse)
reverse_2 = Reverse(rest_of_list_2)
flatten_completely_2 = FlattenList(reverse_2)
build_sublists_2 = Sublists("1..x", Point_List, formula, Row_Number, lacing=Longest)
# note: Drop Last Column
reverse_3 = Reverse(build_sublists_2)
rest_of_list_3 = Rest(reverse_3)
reverse_4 = Reverse(rest_of_list_3)
flatten_completely_3 = FlattenList(reverse_4)
# note: Drop First Column
rest_of_list_4 = Rest(build_sublists_2)
flatten_completely_4 = FlattenList(rest_of_list_4)
list = NewList(index0=flatten_completely, index1=flatten_completely_2, index2=flatten_completely_3, index3=flatten_completely_4)
transpose_lists = Transpose(list)
Quads = Output(transpose_lists)
