# Dynamo custom node QuadsBySurface.dyf (Dynamo 0.7.0.22156)
# category: EPR
# Get group of 4 points following parametric network of points of the surface

code_block = CodeBlock()
# ---------- code_block.designscript (9 lines) ----------
def QuadAtPointIndices(NetPts: var[][],N1,N2)
{
Pt1=NetPts[N1][N2];
Pt2=NetPts[N1][N2+1];
Pt3=NetPts[N1+1][N2];
Pt4=NetPts[N1+1][N2+1];

return={Pt1,Pt2,Pt3,Pt4};
}
# ----------------------------------------
Surf = Input()
U = Input()
V = Input()
code_block_2 = CodeBlock(Surf, U, V) { Pts=Surf.PointAtParameter((0..1..#U1)<1>,(0..1..#U2)<2>); QuadAtPointIndices(Pts,(0..(U1-2))<1>,(0..(U2-2))<2>); }
PointsNet = Output(code_block_2.Pts)
Quads = Output(code_block_2.out1)
