# Dynamo custom node Read Solar Radiation Data.dyf (Dynamo 0.6.2.26476)
# category: Ian
# Read solar radiation data from Vasari.

number = DoubleInput(1)
get_from_list = GetFromList(number)
string = StringInput(",")
split_string = SplitString(arg1=string)
number_2 = DoubleInput(4)
number_3 = DoubleInput(1)
path = Input()
read_text_file = FileReader(path)
string_2 = StringInput("\n")
split_string_2 = SplitString(read_text_file, string_2)
reverse = Reverse(split_string_2)
drop_from_list = DropList(number_3, reverse)
reverse_2 = Reverse(drop_from_list)
drop_from_list_2 = DropList(number_2, reverse_2)
map = Map(split_string, drop_from_list_2)
map_2 = Map(get_from_list, map)
string_to_number = String2Num(map_2, lacing=Longest)
value = Output(string_to_number)
xyz_from_list_of_numbers = XyzFromListOfNumbers()
number_4 = DoubleInput(8)
build_sublists = Sublists("5..7", map, number_4, lacing=Longest)
# note: Normal points
flatten_completely = FlattenList(build_sublists)
number_5 = DoubleInput(3)
build_sublists_2 = Sublists("0..2", flatten_completely, number_5, lacing=Longest)
string_to_number_2 = String2Num(build_sublists_2, lacing=Longest)
map_3 = Map(xyz_from_list_of_numbers, string_to_number_2)
flatten_completely_2 = FlattenList(map_3)
normal = Output(flatten_completely_2)
build_sublists_3 = Sublists("2..4", map, number_4, lacing=Longest)
# note: XYZ points
flatten_completely_3 = FlattenList(build_sublists_3)
build_sublists_4 = Sublists("0..2", flatten_completely_3, number_5, lacing=Longest)
string_to_number_3 = String2Num(build_sublists_4, lacing=Longest)
map_4 = Map(xyz_from_list_of_numbers, string_to_number_3)
flatten_completely_4 = FlattenList(map_4)
xyz = Output(flatten_completely_4)
