# Dynamo custom node Remove List Intersection.dyf (Dynamo 0.6.3.7993)
# category: JBE
# returns a list of elements that are not in both lists

listA = Input()
turn_into_list = Custom[Turn Into List](item=listA)  # Turns an element into a (flat) list
listB = Input()
turn_into_list_2 = Custom[Turn Into List](item=listB)
remove_list_intersection = Python(turn_into_list, turn_into_list_2)
# ---------- remove_list_intersection.python (21 lines) ----------
# Default imports
import clr
clr.AddReference('RevitAPI')
clr.AddReference('RevitAPIUI')
from Autodesk.Revit.DB import *
import Autodesk
import sys
import clr
path = r'C:\Autodesk\Dynamo\Core'
exec_path = r'C:\Autodesk\Dynamo\Core\dll'
sys.path.append(path)
sys.path.append(exec_path)
clr.AddReference('LibGNet')
from Autodesk.LibG import *

listA = IN0
listB = IN1
b=[]
a=list(set(listA).symmetric_difference(set(listB)))
b.append(a)
OUT = a
# ----------------------------------------
list = Output(remove_list_intersection)
