# Dynamo custom node Search In BuiltInParameters.dyf (Dynamo 0.6.3.31052)
# category: CAAD_RWTH.Scripting
# Lets you search in Revit's built-in parameters. Search is case-sensitive. Use * as a wildcard.

search_term = Input()
string = StringInput("*")
string_2 = StringInput("\w*")
replace_substring = Custom[Replace Substring](string_s=search_term, search=string, replace=string_2)  # Replaces a specified part (substring) of a string by another string
list_builtinparameters = Custom[List BuiltInParameters]()  # List all the BuiltInCategories available
filter_list_by_regular = Custom[Filter List by Regular Expression Matches](regex=replace_substring, list=list_builtinparameters)  # Filters out all items from a list of strings that don't begin with the regular expression. The syntax for regular expressions is explained at http://ironpython-test.readthedocs.org/en/latest/howto/regex.html
results = Output(filter_list_by_regular.in)
