# Dynamo custom node Get API Property.dyf (Dynamo 0.6.2.29585)
# category: DME.Revit
# Returns the value of the given property of the given object

object = Input()
property = Input()
python_script_with_variable = Python(object, property)  # "Python Script With Variable Number of Inputs"
# ---------- python_script_with_variable.python (26 lines) ----------
# Default imports
import clr
clr.AddReference('RevitAPI')
clr.AddReference('RevitAPIUI')
from Autodesk.Revit.DB import *
import Autodesk
import sys
import clr
path = r'C:\Autodesk\Dynamo\Core'
exec_path = r'C:\Autodesk\Dynamo\Core\dll'
sys.path.append(path)
sys.path.append(exec_path)
clr.AddReference('LibGNet')
from Autodesk.LibG import *

#The input to this node will be stored in the IN0...INX variable(s).
el = IN0
prop = IN1

try:
	result = [getattr(e, prop) for e in el]
except:
	result = getattr(el, prop)
	
#Assign your output to the OUT variable
OUT = result
# ----------------------------------------
value = Output(python_script_with_variable)
