# Dynamo custom node Iterable to List.dyf (Dynamo 0.6.2.29585)
# category: DME.Revit
# Returns the members of an iterable collection as a list

iterable = Input()
python_script = Python(iterable)
# ---------- python_script.python (21 lines) ----------
# Default imports
import clr
clr.AddReference('RevitAPI')
clr.AddReference('RevitAPIUI')
from Autodesk.Revit.DB import *
import Autodesk
import sys
import clr
path = r'C:\Autodesk\Dynamo\Core'
exec_path = r'C:\Autodesk\Dynamo\Core\dll'
sys.path.append(path)
sys.path.append(exec_path)
clr.AddReference('LibGNet')
from Autodesk.LibG import *

#The input to this node will be stored in the IN variable.
iterable = IN
list = [e for e in iterable]

#Assign your output to the OUT variable
OUT = list
# ----------------------------------------
list = Output(python_script)
