# Dynamo custom node Get Room Boundaries.dyf (Dynamo 0.6.3.5244)
# category: CAAD_RWTH.Revit.Rooms
# Gets a list of all boundary elements of a given room

Room_s = Input()  # "Room(s)"
turn_into_list = Custom[Turn Into List](item=Room_s)  # Turns an element into a (flat) list
remove_duplicate_revit_elements = Custom[Remove Duplicate Revit Elements From List]()  # Removes all duplicates of Revit elements from a given list. (Will also remove any other duplicates from a list...)
revit_document = RevitDocument(lacing=Longest)
python_script_with_variable = Python(revit_document, turn_into_list)  # "Python Script With Variable Number of Inputs"
# ---------- python_script_with_variable.python (32 lines) ----------
import clr
clr.AddReference('RevitAPI')
clr.AddReference('RevitAPIUI')
from Autodesk.Revit.DB import *
import Autodesk

doc = IN0
items = IN1
elementlist = list()

calculator = SpatialElementGeometryCalculator(doc)
options = Autodesk.Revit.DB.SpatialElementBoundaryOptions()
for item in items:
	#method #1 - get boundary segments
	blist = list()
	try:
		for boundarylist in item.GetBoundarySegments(options):
			for boundary in boundarylist:
				blist.append(boundary.Element)
	except:
		donothing = 1
	#method #2 - spatial element geometry calculator
	try:
		results = calculator.CalculateSpatialElementGeometry(item)
		for face in results.GetGeometry().Faces:
			for bface in results.GetBoundaryFaceInfo(face):
				blist.append(doc.GetElement(bface.SpatialBoundaryElement.HostElementId))
	except:
		donothing = 1	
	# write results to list
	elementlist.append(blist)
OUT = elementlist
# ----------------------------------------
map = Map(remove_duplicate_revit_elements.elements, python_script_with_variable)
return_list_or_single_value = Custom[Return List Or Single Value](list_1=turn_into_list, list_2=map)  # If the list in input #1 has only one item, only the first item of the list in input #2 will be returned.
Elements = Output(return_list_or_single_value)
