# Dynamo custom node Rotate Family.dyf (Dynamo 0.6.3.5244)
# category: Revit.Families
# Rotates Family in a Project around Z axis from its origin point and specified angle

id_s = Input()  # "id's"
empty_list = Empty()
list = NewList(index0=id_s, index1=empty_list)
flatten_completely = FlattenList(list)
axis = Input()
list_2 = NewList(index0=axis, index1=empty_list)
flatten_completely_2 = FlattenList(list_2)
angle = Input()
list_3 = NewList(index0=angle, index1=empty_list)
flatten_completely_3 = FlattenList(list_3)
rotate_family = Python(flatten_completely, flatten_completely_2, flatten_completely_3)
# ---------- rotate_family.python (30 lines) ----------
# Default imports
import clr
clr.AddReference('RevitAPI')
clr.AddReference('RevitAPIUI')
from Autodesk.Revit.DB import *
import Autodesk
import sys
import clr
path = r'C:\Autodesk\Dynamo\Core'
exec_path = r'C:\Autodesk\Dynamo\Core\dll'
sys.path.append(path)
sys.path.append(exec_path)
clr.AddReference('LibGNet')
from Autodesk.LibG import *

doc = __doc__
#The input to this node will be stored in the IN0...INX variable(s).
dataEnteringNode = IN0

lmnt_ids = IN0
axises = IN1
angles = IN2
result = []

for axis_, angle_, lmnt_id_ in zip(axises, angles, lmnt_ids):
	result.append(ElementTransformUtils.RotateElement(doc, lmnt_id_, axis_, angle_))


#Assign your output to the OUT variable
OUT = result
# ----------------------------------------
transaction = Transaction(rotate_family)
