# Dynamo custom node Scale Results for Parameter Type.dyf (Dynamo 0.6.3.7993)
# category: CEE120.SESSION11
# Scale the results returned to match the values reported in Revit (fixes a unit reporting error)

parameterType = Input()
string = StringInput("length")
equal = Equal(parameterType, string)
number = DoubleInput(1)
string_2 = StringInput("area")
equal_2 = Equal(parameterType, string_2)
number_2 = DoubleInput(3.28084)
string_3 = StringInput("volume")
equal_3 = Equal(parameterType, string_3)
number_3 = DoubleInput(10.764)
number_4 = DoubleInput(1)
if_ = Conditional(equal_3, number_3, number_4)
if_2 = Conditional(equal_2, number_2, if_)
if_3 = Conditional(equal, number, if_2)
scalingFactor = Output(if_3)
