# Dynamo custom node Select by Bounding Box.dyf (Dynamo 0.6.3.7993)
# category: JBE
# select elements that intersect or are inside an element bounding box

Element_as_Box = Input()
get_bounding_box = Custom[Get Bounding Box](Element_s=Element_as_Box)  # Gets the bounding box of a Revit element
Bounding_Box = Output(get_bounding_box.bbox)
number = DoubleInput(0)
first_of_list = First(get_bounding_box.top_right_front_corner)
first_of_list_2 = First(get_bounding_box.bottom_left_rear_corner)
Category_ies_to_test = Input()  # "Category(ies) to test"
turn_into_list = Custom[Turn Into List](item=Category_ies_to_test)  # Turns an element into a (flat) list
python_script_with_variable = Python(first_of_list, first_of_list_2, turn_into_list)  # "Python Script With Variable Number of Inputs"
# ---------- python_script_with_variable.python (45 lines) ----------
# Default imports
import clr
clr.AddReference('RevitAPI')
clr.AddReference('RevitAPIUI')
from Autodesk.Revit.DB import *
import Autodesk
import sys
import clr
path = r'C:\Autodesk\Dynamo\Core'
exec_path = r'C:\Autodesk\Dynamo\Core\dll'
sys.path.append(path)
sys.path.append(exec_path)
clr.AddReference('LibGNet')
from Autodesk.LibG import *

app = __revit__.Application
document = __revit__.ActiveUIDocument.Document

minXYZ = IN0
maxXYZ = IN1
cat = IN2

elementlist = []
intersect = []
outline = Outline(minXYZ,maxXYZ)

boxfilter = BoundingBoxIsInsideFilter(outline, False)

intersectbox = BoundingBoxIntersectsFilter(outline)

for item in cat:
	try:
		collector = FilteredElementCollector(document).OfCategory(item)
		elementlist.append(collector.WherePasses(boxfilter).WhereElementIsNotElementType().ToElements())
	except:
		OUT = 0
		
for item in cat:
	try:
		collector = FilteredElementCollector(document).OfCategory(item)
		intersect.append(collector.WherePasses(intersectbox).WhereElementIsNotElementType().ToElements())
	except:
		OUT = 0			

OUT=[elementlist,intersect]
# ----------------------------------------
inside_entirely = GetFromList(number, python_script_with_variable)
elements_to_ids = Custom[Elements to IDs](Element_s=inside_entirely)  # Gets the ID(s) for a list of Revit elements (or a single element)
number_2 = DoubleInput(1)
intersect = GetFromList(number_2, python_script_with_variable)
elements_to_ids_2 = Custom[Elements to IDs](Element_s=intersect)
remove_list_intersection = Custom[Remove List Intersection](listA=elements_to_ids.ID_s, listB=elements_to_ids_2.ID_s)  # returns a list of elements that are not in both lists
ids_to_elements = Custom[IDs to Elements](ID_s=remove_list_intersection)  # Gets the Revit element(s) for a list of IDs (or a single ID)
Intersect = Output(ids_to_elements.Element_s)
Full_inside = Output(inside_entirely)
