# Dynamo custom node Sequential Loft.dyf
# category: Create Geometry.Surface
# Sequence of lofts generated considering a pair of reference curves at a time.
# Could be used when loft geometry isn't automatically generated from a list of reference curves.

list = Input()
list_length = Length(list)
number = DoubleInput(2)
less_than = LessThan(list_length, number)
empty_list = Empty()
boolean = BoolSelector(true)
take_from_list = TakeList(number, list)
loft_form = LoftForm(boolean, take_from_list, boolean, FormId=34596, PreferSurfaceForOneLoop=true, FormCurveToReferenceCurveMap="34315=34596;34316=34596;", lacing=Longest)
rest_of_list = Rest(list)
sequential_loft = Custom[Sequential Loft](list=rest_of_list)  # Sequence of lofts generated considering a pair of reference curves at a time. Could be used when loft geometry isn't automatically generated from a list of reference curves.
add_to_list = List(loft_form, sequential_loft)
if_ = Conditional(less_than, empty_list, add_to_list)
loft = Output(if_)
