# Dynamo custom node Set Active Family Parameter.dyf (Dynamo 0.6.3.22045)
# category: Revit.Families
# Use a python script to Set Active Family Parameter

name = Input()
value = Input()
python_script_with_variable = Python(name, value)  # "Python Script With Variable Number of Inputs"
# ---------- python_script_with_variable.python (34 lines) ----------
# Default imports
import clr
clr.AddReference('RevitAPI')
clr.AddReference('RevitAPIUI')
import Autodesk
from Autodesk.Revit.DB import *
import sys
import clr
path = r'C:\Autodesk\Dynamo\Core'
exec_path = r'C:\Autodesk\Dynamo\Core\dll'
sys.path.append(path)
sys.path.append(exec_path)
clr.AddReference('LibGNet')
from Autodesk.LibG import *

app = __revit__.Application
doc = __revit__.ActiveUIDocument.Document
 

paramName = str(IN0)
paramValue = IN1


def setParameter(paramName,paramValue):

	#define parameter variable
	parameter = [a for a in doc.FamilyManager.Parameters if a.Definition.Name==paramName ][0]
	#set parameter	
	doc.FamilyManager.Set(parameter, paramValue)
	
	
setParameter(paramName,paramValue)

OUT = paramValue
# ----------------------------------------
transaction = Transaction(python_script_with_variable)
Output = Output(transaction)  # ""
