# Dynamo custom node Set List Instance Parameters.dyf (Dynamo 0.6.3.35252)
# category: Core.Lists.Modify
# Set the instance parameters of elements in a list

list_of_items = Input()
is_empty_list = IsEmpty(list_of_items)
empty_list = Empty()
number = DoubleInput(0)
get_from_list = GetFromList(number, list_of_items)
parm_name = Input()
list_of_values = Input()
get_from_list_2 = GetFromList(number, list_of_values)
python_script_with_variable = Python(get_from_list, parm_name, get_from_list_2)  # "Python Script With Variable Number of Inputs"
# ---------- python_script_with_variable.python (13 lines) ----------
import clr
clr.AddReference('RevitAPI')
clr.AddReference('RevitAPIUI')
from Autodesk.Revit.DB import *
import Autodesk

item = IN0
param = IN1
val = IN2

item.Parameter[param].Set(val)

OUT = val
# ----------------------------------------
rest_of_list = Rest(list_of_items)
rest_of_list_2 = Rest(list_of_values)
set_list_instance_parameters = Custom[Set List Instance Parameters](list_of_items=rest_of_list, parm_name=parm_name, list_of_values=rest_of_list_2)  # Set the instance parameters of elements in a list
add_to_list = List(python_script_with_variable, set_list_instance_parameters)
if_ = Conditional(is_empty_list, empty_list, add_to_list)
list = Output(if_)
