# Dynamo custom node Set Multiple Family Instance Parameters.dyf (Dynamo 0.6.2.29585)
# category: Revit.Families
# Set multiple family instance parameters by inputting a list of parameter names and a corresponding list of parameter values.

List_of_Parameter_Names = Input()
is_empty_list = IsEmpty(List_of_Parameter_Names)
Family_Instance = Input()
first_of_list = First(List_of_Parameter_Names)
List_of_Parameter_Values = Input()
first_of_list_2 = First(List_of_Parameter_Values)
set_family_instance_parameter = FamilyInstanceParameterSetter(Family_Instance, first_of_list, first_of_list_2, lacing=Longest)
rest_of_list = Rest(List_of_Parameter_Names)
rest_of_list_2 = Rest(List_of_Parameter_Values)
set_multiple_family_instance = Custom[Set Multiple Family Instance Parameters](Family_Instance=set_family_instance_parameter, List_of_Parameter_Names=rest_of_list, List_of_Parameter_Values=rest_of_list_2)  # Set multiple family instance parameters by inputting a list of parameter names and a corresponding list of parameter values.
if_ = Conditional(is_empty_list, Family_Instance, set_multiple_family_instance)
fi = Output(if_)
