# Dynamo custom node Rotate X Origin.dyf (Dynamo 0.7.0.26170)
# category: Modify Geometry.Transform
# Creates a rotation transform around the x-axis at (0,0,0)

XYZ = Xyz(lacing=Longest)
number = DoubleInput(1)
XYZ_2 = Xyz(number, lacing=Longest)
dn = Input()
rotate_transform = TransformRotation(XYZ, XYZ_2, dn, lacing=Longest)
