# Dynamo custom node Rotate Y Origin.dyf (Dynamo 0.7.0.26170)
# category: Modify Geometry.Transform
# Creates a rotation transform around the y-axis at (0,0,0)

XYZ = Xyz(lacing=Longest)
number = DoubleInput(1)
XYZ_2 = Xyz(arg1=number, lacing=Longest)
dn = Input()
rotate_transform = TransformRotation(XYZ, XYZ_2, dn, lacing=Longest)
