# Dynamo custom node Slingshot! INSERT INTO.dyf (Dynamo 0.6.2.29585)
# category: Core.Lists.Query
# SQL INSERT INTO VALUES command.

Table = Input()
Columns = Input()
Values = Input()
list = NewList(index0=Table, index1=Columns, index2=Values)
python_script = Python(list)
# ---------- python_script.python (66 lines) ----------
# Default imports
import clr
clr.AddReference('RevitAPI')
clr.AddReference('RevitAPIUI')
from Autodesk.Revit.DB import *
import Autodesk
import sys
import clr
path = r'C:\Autodesk\Dynamo\Core'
exec_path = r'C:\Autodesk\Dynamo\Core\dll'
sys.path.append(path)
sys.path.append(exec_path)
clr.AddReference('LibGNet')
from Autodesk.LibG import *

#The input to this node will be stored in the IN variable.
_table = IN[0]
_columns = IN[1]
_values = IN[2]

#columns string
if hasattr(_columns, "__iter__"):
	colstr = _columns[0]
	for i in range(0,len(_columns)-1):
		colstr = colstr + "," + _columns[i+1]
else:
	colstr = _columns

#flip values matrix and create string list

_valstrings = []
if hasattr(_values, "__iter__"):
	testvals = _values[0]
	if hasattr(testvals, "__iter__"):
		_flipvalues = []
		for i in range(0,len(_values[0])):
			vals = []
			for j in range(0,len(_values)):
				val = _values[j]
				vals.append(val[i])
			_flipvalues.append(vals)
		
		for i in range(0,len(_flipvalues)):
			vals = _flipvalues[i]
			valstr = "'" + vals[0] + "'"
			for j in range(0,len(vals)-1):
				valstr = valstr + ",'" + vals[j+1] + "'"
			_valstrings.append(valstr)
	else:
		for i in range(0,len(_values)):
			valstr = "'" + _values[i] + "'"
			_valstrings.append(valstr)
else:
	_valstrings = _values
	
#SQL
sql = []
if hasattr(_valstrings, "__iter__"):
	for i in range(0,len(_valstrings)):
		sqlstr = 'INSERT INTO ' + _table + '(' + colstr + ') VALUES (' + _valstrings[i] + ");"
		sql.append(sqlstr)
else:
	sql = 'INSERT INTO ' + _table + '(' + colstr + ') VALUES (' + _valstrings + ");"

#Assign your output to the OUT variable
OUT = sql
# ----------------------------------------
SQL = Output(python_script)
watch = Watch(python_script)
