# Dynamo custom node Slingshot! MySQL Command.dyf (Dynamo 0.6.2.29585)
# category: Input/Output.File
# Send a command to a MySQL Database Server

ConnectionString = Input()
Connect = Input()
Command = Input()
list = NewList(index0=ConnectionString, index1=Connect, index2=Command)
python_script = Python(list)
# ---------- python_script.python (59 lines) ----------
#Slingshot! for Dynamo
#An Open Source project by Nathan Miller
#http://TheProvingGround.org

# Default imports
import clr
clr.AddReference('RevitAPI')
clr.AddReference('RevitAPIUI')
from Autodesk.Revit.DB import *
import Autodesk
import sys
import clr
path = r'C:\Autodesk\Dynamo\Core'
exec_path = r'C:\Autodesk\Dynamo\Core\dll'
sys.path.append(path)
sys.path.append(exec_path)
clr.AddReference('LibGNet')
from Autodesk.LibG import *

#Reference to System.Data.SQLite library
clr.AddReference('MySQL.Data.dll')
from MySql import *
import MySql

#The input to this node will be stored in the IN variable.
cs = IN[0]
connect = IN[1]
cmds = IN[2]

status = []
if connect == True:
	if hasattr(cmds, "__iter__"):
		for cmd in cmds:
			#SQLite Connection
			MySQLConnect = MySql.Data.MySqlClient.MySqlConnection(cs)
			MySQLData = MySql.Data.MySqlClient.MySqlDataAdapter()
			MySQLConnect.Open()
			status.append(MySQLConnect.State.ToString())
			#SQLite Command
			MySQLData.InsertCommand = MySql.Data.MySqlClient.MySqlCommand(cmd, MySQLConnect)
			MySQLData.InsertCommand.ExecuteNonQuery()
			status.append(cmd)
			MySQLConnect.Close()
			status.append(MySQLConnect.State.ToString())
	else:
		#SQLite Connection
		MySQLConnect = MySql.Data.MySqlClient.MySqlConnection(cs)
		MySQLData = MySql.Data.MySqlClient.MySqlDataAdapter()
		MySQLConnect.Open()
		status.append(MySQLConnect.State.ToString())
		#SQLite Command
		MySQLData.InsertCommand = MySql.Data.MySqlClient.MySqlCommand(cmds, MySQLConnect)
		MySQLData.InsertCommand.ExecuteNonQuery()
		status.append(cmds)
		MySQLConnect.Close()
		status.append(MySQLConnect.State.ToString())

#Assign your output to the OUT variable
OUT = status
# ----------------------------------------
Messages = Output(python_script)
