# Dynamo custom node Slingshot! MySQL Connection.dyf (Dynamo 0.6.2.29585)
# category: Input/Output.File
# Connection string for MySQL server

Server = Input()
Port = Input()
Username = Input()
Password = Input()
list = NewList(index0=Server, index1=Port, index2=Username, index3=Password)
python_script = Python(list)
# ---------- python_script.python (29 lines) ----------
#Slingshot! for Dynamo
#An Open Source project by Nathan Miller
#http://TheProvingGround.org

# Default imports
import clr
clr.AddReference('RevitAPI')
clr.AddReference('RevitAPIUI')
from Autodesk.Revit.DB import *
import Autodesk
import sys
import clr
path = r'C:\Autodesk\Dynamo\Core'
exec_path = r'C:\Autodesk\Dynamo\Core\dll'
sys.path.append(path)
sys.path.append(exec_path)
clr.AddReference('LibGNet')
from Autodesk.LibG import *

#The input to this node will be stored in the IN variable.
server = IN[0]
port = IN[1]
user = IN[2]
password = IN[3]

cstring = 'Server=' + server + '; Port=' + port + '; Uid=' + user + '; Pwd=' + password

#Assign your output to the OUT variable
OUT = cstring
# ----------------------------------------
String = Output(python_script)
