# Dynamo custom node Slingshot! SELECT FROM.dyf (Dynamo 0.6.2.29585)
# category: Core.Lists.Query
# SQL 'SELECT FROM' query.

SELECT = Input()
FROM = Input()
list = NewList(index0=SELECT, index1=FROM)
python_script = Python(list)
# ---------- python_script.python (23 lines) ----------
# Default imports
import clr
clr.AddReference('RevitAPI')
clr.AddReference('RevitAPIUI')
from Autodesk.Revit.DB import *
import Autodesk
import sys
import clr
path = r'C:\Autodesk\Dynamo\Core'
exec_path = r'C:\Autodesk\Dynamo\Core\dll'
sys.path.append(path)
sys.path.append(exec_path)
clr.AddReference('LibGNet')
from Autodesk.LibG import *

#The input to this node will be stored in the IN variable.
_select = IN[0]
_from = IN[1]

selstring = 'SELECT ' + _select + ' FROM ' + _from + ';'

#Assign your output to the OUT variable
OUT = selstring
# ----------------------------------------
SQL = Output(python_script)
watch = Watch(python_script)
