# Dynamo custom node Slingshot! SQLite Command.dyf (Dynamo 0.6.2.29585)
# category: Input/Output.File
# Execute a SQLite command

Connect = Input()
Path = Input()
Command = Input()
list = NewList(index0=Connect, index1=Path, index2=Command)
python_script = Python(list)
# ---------- python_script.python (63 lines) ----------
#Slingshot! for Dynamo
#An Open Source project by Nathan Miller
#http://TheProvingGround.org

# Default imports
import clr
clr.AddReference('RevitAPI')
clr.AddReference('RevitAPIUI')
from Autodesk.Revit.DB import *
import Autodesk
import sys
import clr
path = r'C:\Autodesk\Dynamo\Core'
exec_path = r'C:\Autodesk\Dynamo\Core\dll'
sys.path.append(path)
sys.path.append(exec_path)
clr.AddReference('LibGNet')
from Autodesk.LibG import *

#Reference to System.Data.SQLite library
clr.AddReference('System.Data.SQLite.dll')
from System.Data.SQLite import *
import System.Data.SQLite

#The input to this node will be stored in the IN variable.
connect = IN[0]
filepath = IN[1]
cmds = IN[2]

status = []
if connect == True:
	if hasattr(cmds, "__iter__"):
		for cmd in cmds:
			#SQLite Connection
			SQLConnect = System.Data.SQLite.SQLiteConnection()
			SQLConnect.ConnectionString = 'Data Source=' + filepath
			SQLConnect.Open()
			status.append(SQLConnect.State.ToString())
			#SQLite Command
			SQLCommand = SQLConnect.CreateCommand()
			SQLCommand.CommandText = cmd
			status.append(SQLCommand.CommandText.ToString())
			SQLCommand.ExecuteNonQuery()
			SQLCommand.Dispose()
			SQLConnect.Close()
			status.append(SQLConnect.State.ToString())
	else:
		#SQLite Connection
		SQLConnect = System.Data.SQLite.SQLiteConnection()
		SQLConnect.ConnectionString = 'Data Source=' + filepath
		SQLConnect.Open()
		status.append(SQLConnect.State.ToString())
		#SQLite Command
		SQLCommand = SQLConnect.CreateCommand()
		SQLCommand.CommandText = cmds
		status.append(SQLCommand.CommandText.ToString())
		SQLCommand.ExecuteNonQuery()
		SQLCommand.Dispose()
		SQLConnect.Close()
		status.append(SQLConnect.State.ToString())

#Assign your output to the OUT variable
OUT = status
# ----------------------------------------
Messages = Output(python_script)
