# Dynamo custom node Slingshot! SQLite Query.dyf (Dynamo 0.6.2.29585)
# category: Input/Output.File
# Query a SQLite database.

Connect = Input()
Path = Input()
Query = Input()
list = NewList(index0=Connect, index1=Path, index2=Query)
python_script = Python(list)
# ---------- python_script.python (66 lines) ----------
#Slingshot! for Dynamo
#An Open Source project by Nathan Miller
#http://TheProvingGround.org

# Default imports
import clr
clr.AddReference('RevitAPI')
clr.AddReference('RevitAPIUI')
from Autodesk.Revit.DB import *
import Autodesk
import sys
import clr
path = r'C:\Autodesk\Dynamo\Core'
exec_path = r'C:\Autodesk\Dynamo\Core\dll'
sys.path.append(path)
sys.path.append(exec_path)
clr.AddReference('LibGNet')
from Autodesk.LibG import *

clr.AddReference('System.Data')
from System import Data
from System.Data import DataSet
from System.Data import DataTable

#Reference to System.Data.SQLite library
clr.AddReference('System.Data.SQLite.dll')
from System.Data.SQLite import *
import System.Data.SQLite

#The input to this node will be stored in the IN variable.
connect = IN[0]
filepath = IN[1]
query = IN[2]

status = []
result = []

#SQLite Connection
SQLConnect = System.Data.SQLite.SQLiteConnection()
SQLConnect.ConnectionString = 'Data Source=' + filepath
SQLConnect.Open()
status.append(SQLConnect.State.ToString())

#SQLite Query
SQLquery = SQLiteDataAdapter(query,SQLConnect)
status.append(query)

#Fill DataSet
SQLDataset = System.Data.DataSet()
SQLquery.Fill(SQLDataset)

#Close Connection
SQLConnect.Close()
status.append(SQLConnect.State.ToString())

#Iterate through Datatable
SQLDatatable = SQLDataset.Tables[0]
for i in range(0,SQLDatatable.Columns.Count):
	row = []
	for j in range(0,SQLDatatable.Rows.Count):
		value = SQLDatatable.Rows[j][i]
		row.append(value)
	result.append(row)

#Assign your output to the OUT variable
OUT = result
# ----------------------------------------
Result = Output(python_script)
