# Dynamo custom node Spherical Inversion.dyf (Dynamo 0.6.3.5258)
# category: buildz
# Performs a spherical inversion of  XY Coordinates

XYZ = Input()
Sphere_Radius = Input()
Sphere_Center = Input()
xyz_distance = XyzDistance(Sphere_Center, XYZ, lacing=Longest)
formula = Formula("x-y", x=Sphere_Radius, y=xyz_distance, lacing=Longest)
scale_xyz_with_base_point = XyzScaleOffset(XYZ, formula, Sphere_Center, lacing=Longest)
xyz = Output(scale_xyz_with_base_point)
