# Dynamo custom node Spherical Projection.dyf (Dynamo 0.6.3.5258)
# category: buildz
# Project flat XYZ coordinates on Sphere

xyz = Input()
xyz_x = XyzGetX(xyz, lacing=Longest)
xyz_y = XyzGetY(xyz, lacing=Longest)
formula = Formula("(2*x)/(1+Pow(x,2)+Pow(y,2))", x=xyz_x, y=xyz_y, lacing=Longest)
formula_2 = Formula("(2*y)/(1+Pow(x,2)+Pow(y,2))", y=xyz_y, x=xyz_x, lacing=Longest)
formula_3 = Formula("(-1+(Pow(x,2))+(Pow(y,2)))/(1+(Pow(x,2))+(Pow(y,2)))", x=xyz_x, y=xyz_y, lacing=Longest)
XYZ = Xyz(formula, formula_2, formula_3, lacing=Longest)
xyz_2 = Output(XYZ)  # "xyz"
