# Dynamo custom node Radial Planes.dyf (Dynamo 0.6.2.17011)
# category: Ian
# Define a series of planes radially with a sweep angle and a number of planes to create

unit_z = XyzBasisZ(lacing=Longest)
number = DoubleInput(100)
sweep_angle = Input()
number_of_planes = Input()
number_2 = DoubleInput(0..sweep..#grids, sweep_angle, number_of_planes, lacing=Longest)
number_3 = DoubleInput(0)
xyz_by_polar_coordinates = XyzFromPolar(number, number_2, number_3, lacing=Longest)
XYZ = Xyz(lacing=Longest)
direction_to_xyz = XyzStartEndVector(xyz_by_polar_coordinates, XYZ, lacing=Longest)
xyz_cross_product = XyzCrossProduct(unit_z, direction_to_xyz, lacing=Longest)
XYZ_2 = Xyz(lacing=Longest)
plane_by_normal_origin = Plane(xyz_cross_product, XYZ_2, lacing=Longest)
planes = Output(plane_by_normal_origin)
