# Dynamo custom node Green.dyf (Dynamo 0.6.3.5262)
# category: CAAD_RWTH.Colours
# Returns the colour green.

number = DoubleInput(0)
number_2 = DoubleInput(128)
color = Color(number, number, number_2, number, lacing=Longest)
n0_128_0 = Output(color)  # "0,128,0"
