# Dynamo custom node Lime.dyf (Dynamo 0.6.3.5262)
# category: CAAD_RWTH.Colours
# Returns the colour lime.

number = DoubleInput(0)
number_2 = DoubleInput(255)
color = Color(number, number, number_2, number, lacing=Longest)
n0_255_0 = Output(color)  # "0,255,0"
