# Dynamo custom node Maroon.dyf (Dynamo 0.6.3.5262)
# category: CAAD_RWTH.Colours
# Returns the colour maroon.

number = DoubleInput(0)
number_2 = DoubleInput(128)
color = Color(number, number_2, number, number, lacing=Longest)
n128_0_0 = Output(color)  # "128,0,0"
