# Dynamo custom node Purple.dyf (Dynamo 0.6.3.5262)
# category: CAAD_RWTH.Colours
# Returns the colour purple.

number = DoubleInput(0)
number_2 = DoubleInput(128)
color = Color(number, number_2, number, number_2, lacing=Longest)
n128_0_128 = Output(color)  # "128,0,128"
