# Dynamo custom node Silver.dyf (Dynamo 0.6.3.5262)
# category: CAAD_RWTH.Colours
# Returns the colour silver.

number = DoubleInput(0)
number_2 = DoubleInput(192)
color = Color(number, number_2, number_2, number_2, lacing=Longest)
n192_192_192 = Output(color)  # "192,192,192"
