# Dynamo custom node Teal.dyf (Dynamo 0.6.3.5262)
# category: CAAD_RWTH.Colours
# Returns the colour teal.

number = DoubleInput(0)
number_2 = DoubleInput(128)
color = Color(number, number, number_2, number_2, lacing=Longest)
n0_128_128 = Output(color)  # "0,128,128"
