# Dynamo custom node White.dyf (Dynamo 0.6.3.5262)
# category: CAAD_RWTH.Colours
# Returns the colour white.

number = DoubleInput(0)
number_2 = DoubleInput(255)
color = Color(number, number_2, number_2, number_2, lacing=Longest)
n255_255_255 = Output(color)  # "255,255,255"
