# Dynamo custom node Yellow.dyf (Dynamo 0.6.3.5262)
# category: CAAD_RWTH.Colours
# Returns the colour yellow.

number = DoubleInput(0)
number_2 = DoubleInput(255)
color = Color(number, number_2, number_2, number, lacing=Longest)
n255_255_0 = Output(color)  # "255,255,0"
