# Dynamo custom node X Axis (Negative).dyf (Dynamo 0.6.3.5256)
# category: CAAD_RWTH.XYZ
# Returns an XYZ of -1,0,0

x_axis = XyzBasisX(lacing=Longest)
negate_xyz = XyzNegate(x_axis, lacing=Longest)
n1_0_0 = Output(negate_xyz)  # "-1,0,0"
