# Dynamo custom node Z Axis (Negative).dyf (Dynamo 0.6.3.5256)
# category: CAAD_RWTH.XYZ
# Returns an XYZ of 0,0,-1

z_axis = XyzBasisZ(lacing=Longest)
negate_xyz = XyzNegate(z_axis, lacing=Longest)
n0_0_1 = Output(negate_xyz)  # "0,0,-1"
