# Dynamo custom node Structural Framing from lists of curves.dyf (Dynamo 0.6.3.21482)
# category: vasshaug
# Creates Structural Framing elements in Revit from lists of curves with up-vector vertical.

type = Input()
list = Input()
flatten_completely = FlattenList(list)
z_axis = XyzBasisZ(lacing=Longest)
list_length = Length(flatten_completely)
repeat = Repeat(z_axis, list_length)
structural_framing = StructuralFraming(type, flatten_completely, repeat)
