# Dynamo custom node cxd.dyf (Dynamo 0.6.2.29585)
# category: Revit.Document

number = DoubleInput(0)
number_2 = DoubleInput(300)
number_3 = DoubleInput(20)
number_range = NumberRange(number, number_2, number_3, lacing=Longest)
watch = Watch(number_range)
