# Dynamo custom node Get Sublist Lengths.dyf (Dynamo 0.6.3.5260)
# category: CAAD_RWTH.Lists.Sublists
# Gets the lengths of all sublists in a given list of lists.

list_length = Length()
list = Input()
map = Map(list_length, list)
lengths = Output(map)
