# Dynamo custom node SurfFrame.dyf (Dynamo 0.7.0.27601)
# category: Geometry.Surface.Create

surface = Input()
code_block = CodeBlock(surface=surface) { surface; }
code_block_2 = CodeBlock { uv = 0..1..0.05; }
pointAtParameter = Surface.PointAtParameter(code_block, code_block_2, code_block_2, lacing=CrossProduct)
flatten = Flatten(pointAtParameter)
count = Count(code_block_2)
dropItems = List.DropItems(flatten, count)
byStartPointEndPoint = Line.ByStartPointEndPoint(dropItems, flatten)
code_block_3 = CodeBlock { 1; }
dropItems_2 = List.DropItems(flatten, code_block_3)
byStartPointEndPoint_2 = Line.ByStartPointEndPoint(flatten, dropItems_2)
normalAtParameter = Surface.NormalAtParameter(code_block, code_block_2, code_block_2, lacing=CrossProduct)
flatten_2 = Flatten(normalAtParameter)
code_block_4 = CodeBlock { 0.5; }
scale = Vector.Scale(flatten_2, code_block_4)
translate = Geometry.Translate(flatten, scale)
byStartPointEndPoint_3 = Line.ByStartPointEndPoint(translate, flatten)
code_block_5 = CodeBlock { 2; }
byPointsRadii = Cone.ByPointsRadii(translate, flatten, code_block_5, code_block_5)
count_2 = Count(flatten_2)
code_block_6 = CodeBlock { 0.1; }
byPointsRadii_2 = Cone.ByPointsRadii(flatten, dropItems_2, code_block_6, code_block_6)
code_block_7 = CodeBlock { 0; }
dropEveryNthItem = List.DropEveryNthItem(byPointsRadii_2, count, code_block_7)
RightStruts = Output(dropEveryNthItem)
byPointsRadii_3 = Cone.ByPointsRadii(dropItems, flatten, code_block_6, code_block_6)
LeftStruts = Output(byPointsRadii_3)
