# Dynamo custom node TriangularShape2D.dyf (Dynamo 0.6.3.33276)
# category: test

CoordinateSystem = Input()
origin = CoordinateSystem.Origin(CoordinateSystem)
XAxis = CoordinateSystem.XAxis(CoordinateSystem)
width = Input()
translate = Geometry.Translate(origin, XAxis, width)
YAxis = CoordinateSystem.YAxis(CoordinateSystem)
height = Input()
translate_2 = Geometry.Translate(origin, YAxis, height)
code_block = CodeBlock(v1=origin, v2=translate, v3=translate_2, v4=origin) { vertices = {v1,v2,v3,v4}; }
code_block_2 = CodeBlock { 1; }
# note: This will create final Triangular shpae
byControlVertices = NurbsCurve.ByControlVertices(code_block, code_block_2)
