# Dynamo custom node Draw Forward.dyf (Dynamo 0.7.0.26798)
# category: Turtle.Actions

current_world = Input()  # "current-world"
split_list = DeCons(current_world)
split_list_2 = DeCons(split_list.out0)
translation = Input()
multiply_transform = Multiplytransform(split_list_2.out0, translation, lacing=Longest)
add_to_list = List(multiply_transform, split_list_2.out1)
line_maker = Input()
# note: Start Point
XYZ = Xyz(lacing=Longest)
transform_point = TransformPoint(split_list_2.out0, XYZ, lacing=Longest)
# note: End Point
XYZ_2 = Xyz(lacing=Longest)
transform_point_2 = TransformPoint(multiply_transform, XYZ_2, lacing=Longest)
apply_function = Apply1(arg1=line_maker, arg2=transform_point, transform_point_2)
first_of_list = First(split_list.out1)
add_to_list_2 = List(apply_function, first_of_list)
list = NewList(index0=add_to_list, index1=add_to_list_2)
