# Dynamo custom node Hexagonal Gosper.dyf (Dynamo 0.7.0.26798)
# category: Turtle.Examples
# Hexagonal Gosper implemented with Turtle Graphics L-System

string = StringInput("AF")
string_2 = StringInput("""A->AF-BF--BF+AF++AFAF+BF-
B->+AF-BFBF--BF-AF++AF+BF
F->""")
order = Input()
# note: Starting Transform
identity_transform = TransformIdentity(lacing=Longest)
scale = Input()
formula = Formula("scale/(Sqrt(7)*order)", scale=scale, order=order, lacing=Longest)
formula_2 = Formula("pi/3", lacing=Longest)
line = LineBound(lacing=Longest)
turtle_graphics = Custom[Turtle Graphics](start=string, rules=string_2, iterations=order, initial_transform=identity_transform, move_length=formula, turn_rotation=formula_2, line_maker=line)  # A Turtle Graphics L-System interpreter. Takes in a starting string and a production rules string of the form: {id1}->{product1} {id2}->{product2} ... {idN}->{productN} Valid commands are: F :: Move forward and draw a line. f :: Move forward. + :: Turn left. - :: Turn right ^ :: Pitch up & :: Pitch down \ :: Roll counter-clockwise / :: Roll clockwise | :: Turn around [ :: Save current position and orientation. ] :: Restore last saved position and orientation.
