# Dynamo custom node Hilbert 3D Curve.dyf "Hilbert 3D" (Dynamo 0.7.0.26798)
# category: Turtle.Examples
# Hilbert 3D Curve implemented with Turtle Graphics L-System

string = StringInput("A")
string_2 = StringInput("""A->B-F+CFC+F-D&F^D-F+&&CFC+F+B//
B->A&F^CFB^F^D^^-F-D^|F^B|FC^F^A//
C->|D^|F^B-F+C^F^A&&FA&F^C+F+B^F^D//
D->|CFB-F+B|FA&F^A&&FB-F+B|FC//""")
order = Input()
identity_transform = TransformIdentity(lacing=Longest)
scale = Input()
formula = Formula("scale / Pow(2, order)", scale=scale, order=order, lacing=Longest)
formula_2 = Formula("pi/2", lacing=Longest)
line = LineBound(lacing=Longest)
turtle_graphics = Custom[Turtle Graphics](start=string, rules=string_2, iterations=order, initial_transform=identity_transform, move_length=formula, turn_rotation=formula_2, line_maker=line)  # A Turtle Graphics L-System interpreter. Takes in a starting string and a production rules string of the form: {id1}->{product1} {id2}->{product2} ... {idN}->{productN} Valid commands are: F :: Move forward and draw a line. f :: Move forward. + :: Turn left. - :: Turn right ^ :: Pitch up & :: Pitch down \ :: Roll counter-clockwise / :: Roll clockwise | :: Turn around [ :: Save current position and orientation. ] :: Restore last saved position and orientation.
