# Dynamo custom node Load Turtle State.dyf (Dynamo 0.7.0.26170)
# category: Turtle.Actions

current_world = Input()  # "current-world"
split_list = DeCons(current_world)
rest_of_list = Rest(split_list.out0)
add_to_list = List(rest_of_list, split_list.out1)
