# Dynamo custom node Move Forward.dyf (Dynamo 0.7.0.26170)
# category: Turtle.Actions

current_world = Input()  # "current-world"
split_list = DeCons(current_world)
split_list_2 = DeCons(split_list.out0)
translation = Input()
multiply_transform = Multiplytransform(split_list_2.out0, translation, lacing=Longest)
add_to_list = List(multiply_transform, split_list_2.out1)
add_to_list_2 = List(add_to_list, split_list.out1)
