# Dynamo custom node Penrose Tiling.dyf (Dynamo 0.7.0.26798)
# category: Turtle.Examples
# Penrose Tiling implemented with Turtle Graphics L-System

string = StringInput("[N]++[N]++[N]++[N]++[N]")
string_2 = StringInput("""M->OF++PF----NF[-OF----MF]++
N->+OF--PF[---MF--NF]+
O->-MF++NF[+++OF++PF]-
P->--OF++++MF[+PF++++NF]--NF
F->""")
order = Input()
# note: Starting Transform
identity_transform = TransformIdentity(lacing=Longest)
scale = Input()
# note: Length of line segments
formula = Formula("scale / Pow(2, order)", scale=scale, order=order, lacing=Longest)
formula_2 = Formula("pi/180*36", lacing=Longest)
line = LineBound(lacing=Longest)
turtle_graphics = Custom[Turtle Graphics](start=string, rules=string_2, iterations=order, initial_transform=identity_transform, move_length=formula, turn_rotation=formula_2, line_maker=line)  # A Turtle Graphics L-System interpreter. Takes in a starting string and a production rules string of the form: {id1}->{product1} {id2}->{product2} ... {idN}->{productN} Valid commands are: F :: Move forward and draw a line. f :: Move forward. + :: Turn left. - :: Turn right ^ :: Pitch up & :: Pitch down \ :: Roll counter-clockwise / :: Roll clockwise | :: Turn around [ :: Save current position and orientation. ] :: Restore last saved position and orientation.
