# Dynamo custom node Perform Action.dyf (Dynamo 0.7.0.26170)
# category: Turtle.Internal

action = Input()
actions = Input()
lookup = Custom[Lookup](key=action, list=actions)  # Locates the first element of the given list whose car is equal to v. If such an element exists, the pair (i.e., an element of the given list) is returned. Otherwise, the result is false.
number = DoubleInput(1)
get_from_list = GetFromList(number, lookup)
world = Input()
apply_function = Apply1(arg1=get_from_list, world)
if_ = Conditional(lookup, apply_function, world)
