# Dynamo custom node Plant.dyf (Dynamo 0.7.0.20435)
# category: Turtle.Examples
# Tree-like geometry generated with Turtle Graphics.

string = StringInput("FLA")
string_2 = StringInput("""A->[&FLA]/////[&FLA]///////[&FLA]
F->S/////F
S->FL
L->[^^F]""")
order = Input()
formula = Formula("-pi/2", lacing=Longest)
rotate_y_origin = Custom[Rotate Y Origin](dn=formula)  # Creates a rotation transform around the y-axis at (0,0,0)
scale = Input()
formula_2 = Formula("pi/180*22.5", lacing=Longest)
line = LineBound(lacing=Longest)
turtle_graphics = Custom[Turtle Graphics](start=string, rules=string_2, iterations=order, initial_transform=rotate_y_origin, move_length=scale, turn_rotation=formula_2, line_maker=line)  # A Turtle Graphics L-System interpreter. Takes in a starting string and a production rules string of the form: {id1}->{product1} {id2}->{product2} ... {idN}->{productN} Valid commands are: F :: Move forward and draw a line. f :: Move forward. + :: Turn left. - :: Turn right ^ :: Pitch up & :: Pitch down \ :: Roll counter-clockwise / :: Roll clockwise | :: Turn around [ :: Save current position and orientation. ] :: Restore last saved position and orientation.
lines = Output(turtle_graphics)
