# Dynamo custom node Rewrite Production.dyf (Dynamo 0.7.0.26170)
# category: Turtle.Internal
# Rewrites an L-system production by replacing all variables with their production rule.

production = Input()
is_empty_list = IsEmpty(production)
result = Input()
reverse = Reverse(result)
split_list = DeCons(production)
rules = Input()
# note: If the character was found in the production rules, then we add all of the replacement characters onto the results list.
lookup = Custom[Lookup](key=split_list.out0, list=rules)  # Locates the first element of the given list whose car is equal to v. If such an element exists, the pair (i.e., an element of the given list) is returned. Otherwise, the result is false.
number = DoubleInput(1)
get_from_list = GetFromList(number, lookup)
# note: If the list of characters comprising the production is empty, then we're done. The accumulator has been built up in reverse, so we reverse it before returning it.
# note: If the list of characters comprising the production is not empty, we take the first character and rewrite it, then we recur with the remaining characters.
concatenate_lists = Append(get_from_list, result)
# note: If the character was not found in the production rules, then we assume that there is no rule, and we keep the character.
add_to_list = List(split_list.out0, result)
if_ = Conditional(lookup, concatenate_lists, add_to_list)
rewrite_production = Custom[Rewrite Production](production=split_list.out1, rules=rules, result=if_)  # Rewrites an L-system production by replacing all variables with their production rule.
if_2 = Conditional(is_empty_list, reverse, rewrite_production)
Output = Output(if_2)  # ""
