# Dynamo custom node Rewrite.dyf (Dynamo 0.7.0.26170)
# category: Turtle.Internal

iterations = Input()
formula = Formula("n<=0", n=iterations, lacing=Longest)
start = Input()
formula_2 = Formula("n-1", n=iterations, lacing=Longest)
rules = Input()
empty_list = Empty()
# note: If iterations are > 0, then perform one rewrite of the production, and recur with one less iteration.
rewrite_production = Custom[Rewrite Production](production=start, rules=rules, result=empty_list)  # Rewrites an L-system production by replacing all variables with their production rule.
# note: If iterations are <= 0, then do nothing.
rewrite = Custom[Rewrite](iterations=formula_2, start=rewrite_production, rules=rules)
if_ = Conditional(formula, start, rewrite)
production = Output(if_)
