# Dynamo custom node Save Turtle State.dyf (Dynamo 0.7.0.26170)
# category: Turtle.Actions

current_world = Input()  # "current-world"
split_list = DeCons(current_world)
first_of_list = First(split_list.out0)
add_to_list = List(first_of_list, split_list.out0)
add_to_list_2 = List(add_to_list, split_list.out1)
