# Dynamo custom node Sierpinski Triangle.dyf "Sierpiński" (Dynamo 0.7.0.26798)
# category: Turtle.Examples
# Sierpiński Arrowhead implemented with Turtle Graphics L-System

string = StringInput("XF")
string_2 = StringInput("""X->YF+XF+Y
Y->XF-YF-X""")
order = Input()
formula = Formula("order%2==1", order=order, lacing=Longest)
identity_transform = TransformIdentity(lacing=Longest)
# note: Even: start at 60 degrees
# note: Odd: identity
formula_2 = Formula("pi/3", lacing=Longest)
rotate_z_origin = Custom[Rotate Z Origin](dn=formula_2)  # Creates a rotation transform around the z-axis at (0,0,0)
# note: Starting Transform
if_ = Conditional(formula, identity_transform, rotate_z_origin)
scale = Input()
formula_3 = Formula("scale / Pow(2, order)", scale=scale, order=order, lacing=Longest)
formula_4 = Formula("pi/3", lacing=Longest)
line = LineBound(lacing=Longest)
turtle = Custom[Turtle](start=string, rules=string_2, iterations=order, initial_transform=if_, move_length=formula_3, turn_rotation=formula_4, line_maker=line)
