# Dynamo custom node String 2 Turtle Rules.dyf "String -> Turtle Rules" (Dynamo 0.7.0.26170)
# category: Turtle.Internal
# Converts a string representation of turtle production rules into the internal associative list representation.

rule_str_rule = Custom[rule str -> rule]()
rule_string = Input()
string = StringInput("\n")
split_string = SplitString(rule_string, string)
map = Map(rule_str_rule, split_string)
rules = Output(map)
