# Dynamo custom node Turtle.dyf "Turtle Graphics" (Dynamo 0.7.0.26798)
# category: Turtle
# A Turtle Graphics L-System interpreter. Takes in a starting string and a production rules string of the form:
#   {id1}->{product1}
#   {id2}->{product2}
#   ...
#   {idN}->{productN}
# Valid commands are:
#   F  :: Move forward and draw a line.
#   f  :: Move forward.
#   +  :: Turn left.
#   -  :: Turn right
#   ^  :: Pitch up
#   &  :: Pitch down
#   \  :: Roll counter-clockwise
#   /  :: Roll clockwise
#   |  :: Turn around
#   [  :: Save current position and orientation.
#   ]  :: Restore last saved position and orientation.

number = DoubleInput(1)
string = StringInput("F")
move_length = Input()
XYZ = Xyz(move_length, lacing=Longest)
translate_transform = TransformTranslation(XYZ, lacing=Longest)
line_maker = Input()
# note: Action bindings. Each character is bound to an action that produces a new turtle transform and accumulated output.
draw_forward = Custom[Draw Forward](translation=translate_transform, line_maker=line_maker)
list = NewList(index0=string, index1=draw_forward)
string_2 = StringInput("+")
turn_rotation = Input()
rotate_z_origin = Custom[Rotate Z Origin](dn=turn_rotation)  # Creates a rotation transform around the z-axis at (0,0,0)
turn = Custom[Turn](rotation=rotate_z_origin)
list_2 = NewList(index0=string_2, index1=turn)
string_3 = StringInput("-")
formula = Formula("-angle", angle=turn_rotation, lacing=Longest)
rotate_z_origin_2 = Custom[Rotate Z Origin](dn=formula)
turn_2 = Custom[Turn](rotation=rotate_z_origin_2)
list_3 = NewList(index0=string_3, index1=turn_2)
string_4 = StringInput("[")
save_turtle_state = Custom[Save Turtle State]()
list_4 = NewList(index0=string_4, index1=save_turtle_state)
string_5 = StringInput("]")
load_turtle_state = Custom[Load Turtle State]()
list_5 = NewList(index0=string_5, index1=load_turtle_state)
string_6 = StringInput("f")
move_forward = Custom[Move Forward](translation=translate_transform)
list_6 = NewList(index0=string_6, index1=move_forward)
string_7 = StringInput("^")
rotate_y_origin = Custom[Rotate Y Origin](dn=turn_rotation)  # Creates a rotation transform around the y-axis at (0,0,0)
turn_3 = Custom[Turn](rotation=rotate_y_origin)
list_7 = NewList(index0=string_7, index1=turn_3)
string_8 = StringInput("&")
formula_2 = Formula("-angle", angle=turn_rotation, lacing=Longest)
rotate_y_origin_2 = Custom[Rotate Y Origin](dn=formula_2)
turn_4 = Custom[Turn](rotation=rotate_y_origin_2)
list_8 = NewList(index0=string_8, index1=turn_4)
string_9 = StringInput("\")
rotate_x_origin = Custom[Rotate X Origin](dn=turn_rotation)  # Creates a rotation transform around the x-axis at (0,0,0)
turn_5 = Custom[Turn](rotation=rotate_x_origin)
list_9 = NewList(index0=string_9, index1=turn_5)
string_10 = StringInput("/")
formula_3 = Formula("-angle", angle=turn_rotation, lacing=Longest)
rotate_x_origin_2 = Custom[Rotate X Origin](dn=formula_3)
turn_6 = Custom[Turn](rotation=rotate_x_origin_2)
list_10 = NewList(index0=string_10, index1=turn_6)
string_11 = StringInput("|")
formula_4 = Formula("pi", lacing=Longest)
rotate_z_origin_3 = Custom[Rotate Z Origin](dn=formula_4)
turn_7 = Custom[Turn](rotation=rotate_z_origin_3)
list_11 = NewList(index0=string_11, index1=turn_7)
list_12 = NewList(index0=list, index1=list_2, index2=list_3, index3=list_4, index4=list_5, index5=list_6, index6=list_7, index7=list_8, index8=list_9, index9=list_10, index10=list_11)
# note: Looks up the action corresponding
# to the given character, and uses the
# action to update the given world.
perform_action = Custom[Perform Action](actions=list_12)
initial_transform = Input()
list_13 = NewList(index0=initial_transform)
empty_list = Empty()
list_14 = NewList(index0=list_13, index1=empty_list)
iterations = Input()
start = Input()
# note: Split axiom into separate characters
split_string = SplitString(start)
# note: Parse rules
rules = Input()
string_turtle_rules = Custom[String -> Turtle Rules](rule_string=rules)  # Converts a string representation of turtle production rules into the internal associative list representation.
rewrite = Custom[Rewrite](iterations=iterations, start=split_string, rules=string_turtle_rules)
# note: Reduce all characters in the final production
# into a world state.
reduce = Fold(perform_action, list_14, rewrite)
get_from_list = GetFromList(number, reduce)
lines = Output(get_from_list)
