# Dynamo custom node rule str 2 rule.dyf "rule str -> rule" (Dynamo 0.7.0.26170)
# category: Turtle.Internal

r = Input()
string = StringInput("->")
split_string = SplitString(r, string)
split_list = DeCons(split_string)
first_of_list = First(split_list.out1)
split_string_2 = SplitString(first_of_list)
reverse = Reverse(split_string_2)
list = NewList(index0=split_list.out0, index1=reverse)
Output = Output(list)  # ""
