# Dynamo custom node Type Name.dyf (Dynamo 0.6.2.21747)
# category: Core.Types
# Gets the type of the given data as a string.

Input = Input()
python_script = Python(Input)
# ---------- python_script.python (3 lines) ----------
from System import *

OUT = str(IN.GetType())
# ----------------------------------------
Output = Output(python_script)  # ""
