# Dynamo custom node Union Solids.dyf (Dynamo 0.6.3.16650)
# category: buildz
# union all solids

solids = Input()
list_length = Length(solids)
number = DoubleInput(1)
greater_than = GreaterThan(list_length, number)
split_list = DeCons(solids)
first_of_list = First(split_list.out1)
boolean_union = SolidUnion(split_list.out0, first_of_list, lacing=Longest)
rest_of_list = Rest(split_list.out1)
add_to_list = List(boolean_union, rest_of_list)
union_solids = Custom[Union Solids](solids=add_to_list)  # union all solids
if_ = Conditional(greater_than, union_solids, split_list.out0)
Union = Output(if_)
