# Dynamo custom node Centimeters To Feet.dyf (Dynamo 0.6.3.5260)
# category: CAAD_RWTH.Conversion.Length
# Converts centimeters into feet

cm = Input()
formula = Formula("cm/100/0.3048", cm=cm, lacing=Longest)
ft = Output(formula)
