# Dynamo custom node Feet To Meters.dyf (Dynamo 0.6.3.5260)
# category: CAAD_RWTH.Conversion.Length
# Converts feet into meters

ft = Input()
formula = Formula("feet*0.3048", feet=ft, lacing=Longest)
m = Output(formula)
