# Dynamo custom node Feet To Millimeters.dyf (Dynamo 0.6.3.5260)
# category: CAAD_RWTH.Conversion.Length
# Converts feet into millimeters

ft = Input()
formula = Formula("feet*0.3048*1000", feet=ft, lacing=Longest)
mm = Output(formula)
