# Dynamo custom node Meters To Feet.dyf (Dynamo 0.6.3.5260)
# category: CAAD_RWTH.Conversion.Length
# Converts meters into feet

m = Input()
formula = Formula("meters/0.3048", meters=m, lacing=Longest)
ft = Output(formula)
