# Dynamo custom node Millimeters To Feet.dyf (Dynamo 0.6.3.5260)
# category: CAAD_RWTH.Conversion.Length
# Converts millimeters into feet

mm = Input()
formula = Formula("mm/1000/0.3048", mm=mm, lacing=Longest)
ft = Output(formula)
