# Dynamo custom node Unplace Redundant Rooms.dyf (Dynamo 0.6.3.5244)
# category: Revit.API
# Unplaces rooms that area is equal to 0 (thus redundant)

Rooms = Input()
flatten_completely = FlattenList(Rooms)
delete_redundant_rooms = Python(flatten_completely)
# ---------- delete_redundant_rooms.python (30 lines) ----------
# Default imports
import clr
clr.AddReference('RevitAPI')
clr.AddReference('RevitAPIUI')
from Autodesk.Revit.DB import *
import Autodesk
import sys
import clr
path = r'C:\Autodesk\Dynamo\Core'
exec_path = r'C:\Autodesk\Dynamo\Core\dll'
sys.path.append(path)
sys.path.append(exec_path)
clr.AddReference('LibGNet')
from Autodesk.LibG import *

#The input to this node will be stored in the IN variable.
dataEnteringNode = IN

rooms = IN
valid_rooms = []
room_names = []

for i in rooms:
	if i.Area == 0:
		i.Unplace()
	else:
		valid_rooms.append(i)
		room_names.append(i.get_Parameter("Name").AsString())
#Assign your output to the OUT variable
OUT = [[valid_rooms], [room_names]]
# ----------------------------------------
transaction = Transaction(delete_redundant_rooms)
Rooms_2 = Output(transaction)  # "Rooms"
