# Dynamo custom node Vector by altitude and azimuth.dyf (Dynamo 0.6.3.37653)
# category: Geometry.Point.Create
# XYZ unit vector by altitude (-90° - 90°) and azimuth (0° - 360°) with positive Y-axis as North, positive Z-axis as up.

Deg_Rad = Input()  # "Deg/Rad"
Altitude = Input()
formula = Formula("a*pi/180", a=Altitude, lacing=Longest)
list = NewList(index0=Altitude, index1=formula)
# note: Altitude in radians
get_from_list = GetFromList(Deg_Rad, list)
# note: Phi.
# 0 altitude is perfectly horizontal.
# Translated to angle from positive z-axis
formula_2 = Formula("pi/2 - altitude", altitude=get_from_list, lacing=Longest)
Azimuth = Input()
# note: Y-axis is North
# Azimuthal convention:
# N  =     0°
# E   =   90°
# S   = 180°
# W =  270°
formula_3 = Formula("a*pi/180", a=Azimuth, lacing=Longest)
list_2 = NewList(index0=Azimuth, index1=formula_3)
# note: Azimuth in radians
get_from_list_2 = GetFromList(Deg_Rad, list_2)
# note: Theta.
# 0 azimuth is North (positive Y-axis).
# Translated to CCW from positive X-axis
formula_4 = Formula("(pi/2 - azimuth)%(2*pi)", azimuth=get_from_list_2, lacing=Longest)
formula_5 = Formula("sin(phi) * cos(theta)", phi=formula_2, theta=formula_4, lacing=Longest)
formula_6 = Formula("sin(theta) * sin(phi)", theta=formula_4, phi=formula_2, lacing=Longest)
formula_7 = Formula("cos(phi)", phi=formula_2, lacing=Longest)
XYZ = Xyz(formula_5, formula_6, formula_7, lacing=Longest)
xyz = Output(XYZ)
