# Dynamo custom node Vector-Vector Intersection.dyf (Dynamo 0.6.3.35252)
# category: CAAD_RWTH.XYZ
# Determines if two vectors intersect and returns the closest points of intersection on both vectors.

Vector_1 = Input()  # "Vector #1"
Vector_2 = Input()  # "Vector #2"
# note: Direction projection
xyz_dot_product = XyzDotProduct(Vector_1, Vector_2, lacing=Longest)
# note: if this is 1 or -1 the vectors are parallel
formula = Formula("x=1 or x=-1", x=xyz_dot_product, lacing=Longest)
Vectors_parallel = Output(formula)
# note: Based on:
# http://stackoverflow.com/questions/10551555/need-an-algorithm-for-3d-vectors-intersection
Basepoint_1 = Input()  # "Basepoint #1"
Basepoint_2 = Input()  # "Basepoint #2"
subtract_xyzs = XyzSubtract(Basepoint_2, Basepoint_1, lacing=Longest)
xyz_dot_product_2 = XyzDotProduct(subtract_xyzs, Vector_1, lacing=Longest)
# note: Separation projections
xyz_dot_product_3 = XyzDotProduct(subtract_xyzs, Vector_2, lacing=Longest)
formula_2 = Formula("(t1-u*t2)/(1-u*u)", t1=xyz_dot_product_2, u=xyz_dot_product, t2=xyz_dot_product_3, lacing=Longest)
scale_xyz = XyzScale(Vector_1, formula_2, lacing=Longest)
add_xyzs = XyzAdd(Basepoint_1, scale_xyz, lacing=Longest)
# note: Distances along lines
formula_3 = Formula("(t2-u*t1)/(u*u-1)", t2=xyz_dot_product_3, u=xyz_dot_product, t1=xyz_dot_product_2, lacing=Longest)
scale_xyz_2 = XyzScale(Vector_2, formula_3, lacing=Longest)
add_xyzs_2 = XyzAdd(Basepoint_2, scale_xyz_2, lacing=Longest)
xyz_distance = XyzDistance(add_xyzs, add_xyzs_2, lacing=Longest)
almost_zero = Custom[Almost Zero]()  # Returns a feasable computational tolerance to zero (1.0e-9 or a billionth of 1) for use in calculations. More background info: https://github.com/ikeough/Dynamo/issues/879
formula_4 = Formula("x<almost and x>-almost", x=xyz_distance, almost=almost_zero, lacing=Longest)
Vectors_intersect = Output(formula_4)
Closest_point_on_Vector_1 = Output(add_xyzs)  # "Closest point on Vector #1"
Closest_point_on_Vector_2 = Output(add_xyzs_2)  # "Closest point on Vector #2"
list = NewList(index0=add_xyzs, index1=add_xyzs_2)
average_xyzs = XyzAverage(list, lacing=Longest)
Average_XYZ = Output(average_xyzs)
