# Dynamo custom node Weather File Location.dyf (Dynamo 0.6.3.22045)
# category: Analyze.Energy.Weather
# Gets the path to an EnergyPlus weather file (EPW) and returns location.

number = DoubleInput(1..3)
number_2 = DoubleInput(0)
path = Input()
read_text_file = FileReader(path)
string = StringInput("\n")
split_string = SplitString(read_text_file, string)
get_from_list = GetFromList(number_2, split_string)
string_2 = StringInput(",")
split_string_2 = SplitString(get_from_list, string_2)
get_from_list_2 = GetFromList(number, split_string_2)
string_3 = StringInput(",")
location = JoinStrings(get_from_list_2, string_3)
Location_Name = Output(location)
number_3 = DoubleInput(6)
get_from_list_3 = GetFromList(number_3, split_string_2)
Latitude = Output(get_from_list_3)
number_4 = DoubleInput(7)
get_from_list_4 = GetFromList(number_4, split_string_2)
Longitude = Output(get_from_list_4)
number_5 = DoubleInput(8)
get_from_list_5 = GetFromList(number_5, split_string_2)
Time_Zone = Output(get_from_list_5)
number_6 = DoubleInput(9)
get_from_list_6 = GetFromList(number_6, split_string_2)
Elevation_m = Output(get_from_list_6)  # "Elevation (m)"
