# Dynamo custom node Weave By Surface.dyf (Dynamo 0.6.3.22045)
# category: Geometry.Surface.Divide
# Creates a Weave from a surface

number = DoubleInput(0)
# note: Weave
# By Wassim Jabi (wassim.jabi@gmail.com)
# (c) 2014. All rights reserved.
# This software is provided 'as is' without warranty of any kind, either express or implied, including, but not limited to, the implied warranties of fitness for a purpose, or the warranty of non-infringement.
# note: face: The selected face/surface
face = Input()
# note: Integer: Number of U subdivisions
U_Count = Input()  # "U-Count"
V_Count = Input()  # "V-Count"
# note: Integer: Number of V subdivisions
amplitude = Input()
uv_and_xyz_grid_from_face = Custom[UV And XYZ Grid From Face](face=face, U=U_Count, V=V_Count)  # Returns UV coordinates, XYZ coordinates and normals for a face with UV subdivision
unitize_xyz = XyzNormalize(uv_and_xyz_grid_from_face.Normals, lacing=Longest)
# note: Boolean: To rotate the orientation of the diagrid
# note: Float: Amplitude of the weave
isRotated = Input()
list = NewList(index0=face, index1=U_Count, index2=V_Count, index3=amplitude, index4=uv_and_xyz_grid_from_face.XYZs, index5=unitize_xyz, index6=uv_and_xyz_grid_from_face.UVs, index7=isRotated)
build_warp_and_weft = Python(list)
# ---------- build_warp_and_weft.python (101 lines) ----------
# Default imports
import clr
clr.AddReference('RevitAPI')
clr.AddReference('RevitAPIUI')
from Autodesk.Revit.DB import *
import Autodesk
import sys
import clr
path = r'C:\Autodesk\Dynamo\Core'
exec_path = r'C:\Autodesk\Dynamo\Core\dll'
sys.path.append(path)
sys.path.append(exec_path)
clr.AddReference('LibGNet')
from Autodesk.LibG import *

#The input to this node will be stored in the IN variable.
face = IN[0]
u = int(IN[1] + 1)
v = int(IN[2] + 1)
amp = IN[3]
xyzs = IN[4]
normals = IN[5]
uvs = IN[6]
rotated = IN[7]
outputList = []
def addVector(xyz, v):
	return XYZ(xyz[0]+v[0],xyz[1]+v[1],xyz[2]+v[2])

def scaleVector(xyz, factor):
	return XYZ(xyz[0]*factor,xyz[1]*factor,xyz[2]*factor)



def buildWarp():
	warps= []
	xMultFac = -1
	yMultFac = -1
	for i in range(0,int(u),1):
		vList = []
		if i%2 == 0:
			xMultFac = 1
		else:
			xMultFac = -1
		for j in range(0,int(v),1):
			if j%2 == 0:
				yMultFac = 1
			else:
				yMultFac = -1
			newamp = amp*xMultFac*yMultFac
			newnormal = scaleVector(normals[int((i*v)+j)], newamp)
			vList.append(addVector(xyzs[int((i*v)+j)], newnormal))
		warps.append(vList)
	return warps

def buildWeft():
	wefts= []
	for i in range(0,v,1):
		vList = []
		for j in range(0,u,1):
			vList.append(xyzs[int(j*v + i)])
		wefts.append(vList)
	return wefts

def buildWarpRotated():
	warps= []
	xMultFac = -1
	yMultFac = -1
	for i in range(0,int(v),1):
		vList = []
		if i%2 == 0:
			xMultFac = 1
		else:
			xMultFac = -1
		for j in range(0,int(u),1):
			if j%2 == 0:
				yMultFac = 1
			else:
				yMultFac = -1
			newamp = amp*xMultFac*yMultFac
			newnormal = scaleVector(normals[int((j*v)+i)], newamp)
			vList.append(addVector(xyzs[int((j*v)+i)], newnormal))
		warps.append(vList)
	return warps

def buildWeftRotated():
	wefts= []
	for i in range(0,u,1):
		vList = []
		for j in range(0,v,1):
			vList.append(xyzs[int(i*v + j)])
		wefts.append(vList)
	return wefts
if rotated:
	outputList.append(buildWarpRotated())
	outputList.append(buildWeftRotated())
else:
	outputList.append(buildWarp())
	outputList.append(buildWeft())

#Assign your output to the OUT variable
OUT = outputList
# ----------------------------------------
warp = GetFromList(number, build_warp_and_weft)
number_2 = DoubleInput(1)
weft = GetFromList(number_2, build_warp_and_weft)
join_lists = Append(warp, weft)
# note: List: List of Wefts and Warps XYZs
XYZs = Output(join_lists)
Weft = Output(weft)
Warp = Output(warp)
