# Dynamo custom node Workset ID from Element.dyf (Dynamo 0.6.3.5244)
# category: Revit.Document
# Returns a Workset ID of an Element.

Element_IDs = Input()
workset_id_for_element = Python(Element_IDs)
# ---------- workset_id_for_element.python (27 lines) ----------
# Default imports
import clr
clr.AddReference('RevitAPI')
clr.AddReference('RevitAPIUI')
from Autodesk.Revit.DB import *
import Autodesk
import sys
import clr
path = r'C:\Autodesk\Dynamo\Core'
exec_path = r'C:\Autodesk\Dynamo\Core\dll'
sys.path.append(path)
sys.path.append(exec_path)
clr.AddReference('LibGNet')
from Autodesk.LibG import *

#The input to this node will be stored in the IN variable.
dataEnteringNode = IN
doc = __doc__

ElementId = IN
result = []

for i in ElementId:
	result.append(doc.GetWorksetId(i))

#Assign your output to the OUT variable
OUT = result
# ----------------------------------------
Workset_IDs = Output(workset_id_for_element)
