# Dynamo custom node Write CSV String - Four Values.dyf (Dynamo 0.6.3.7993)
# category: CEE120
# Write a CSV string for four data values

string = StringInput("\n")
dataValue1 = Input()
number_to_string = Num2String(dataValue1, lacing=Longest)
string_2 = StringInput(",")
dataValue2 = Input()
number_to_string_2 = Num2String(dataValue2, lacing=Longest)
dataValue3 = Input()
number_to_string_3 = Num2String(dataValue3, lacing=Longest)
dataValue4 = Input()
number_to_string_4 = Num2String(dataValue4, lacing=Longest)
concat_strings = ConcatStrings(s3=string, s4=number_to_string, s5=string_2, s6=number_to_string_2, s7=string_2, s8=number_to_string_3, string_2, number_to_string_4)
CSVString = Output(concat_strings)
