# Dynamo custom node Write CSV String - Seven_Values.dyf (Dynamo 0.6.3.7993)
# category: CEE120.Session11
# Write a CSV string for two data values

string = StringInput("\n")
dataValue1 = Input()
number_to_string = Num2String(dataValue1, lacing=Longest)
string_2 = StringInput(",")
dataValue2 = Input()
number_to_string_2 = Num2String(dataValue2, lacing=Longest)
dataValue3 = Input()
number_to_string_3 = Num2String(dataValue3, lacing=Longest)
string_3 = StringInput(" ")
dataValue4 = Input()
number_to_string_4 = Num2String(dataValue4, lacing=Longest)
dataValue5 = Input()
number_to_string_5 = Num2String(dataValue5, lacing=Longest)
dataValue6 = Input()
number_to_string_6 = Num2String(dataValue6, lacing=Longest)
dataValue7 = Input()
number_to_string_7 = Num2String(dataValue7, lacing=Longest)
concat_strings = ConcatStrings(s3=string, s4=number_to_string, s5=string_2, s6=number_to_string_2, s7=string_2, s8=number_to_string_3, s9=string_3, s10=number_to_string_4, s11=string_2, s12=number_to_string_5, s13=string_2, s14=number_to_string_6, string_2, number_to_string_7)
CSVString = Output(concat_strings)
