# Dynamo custom node Write CSV String - Three Values.dyf (Dynamo 0.6.3.7993)
# category: CEE120.Session11
# Write a CSV string for two data values

string = StringInput("\n")
dataValue1 = Input()
number_to_string = Num2String(dataValue1, lacing=Longest)
string_2 = StringInput(",")
dataValue2 = Input()
number_to_string_2 = Num2String(dataValue2, lacing=Longest)
dataValue3 = Input()
number_to_string_3 = Num2String(dataValue3, lacing=Longest)
concat_strings = ConcatStrings(s3=string, s4=number_to_string, s5=string_2, s6=number_to_string_2, string_2, number_to_string_3)
CSVString = Output(concat_strings)
