# Dynamo custom node UV And XYZ Grid From Face.dyf (Dynamo 0.6.2.29585)
# category: CAAD_RWTH.XYZ
# Returns UV coordinates, XYZ coordinates and normals for a face with UV subdivision

face = Input()
surface_domain = SurfaceDomain(face)
U = Input()
V = Input()
uv_grid = UvGrid(surface_domain, U, V)
evaluate_uv = XyzEvaluate(uv_grid, face, lacing=Longest)
XYZs = Output(evaluate_uv)
evaluate_normal = NormalEvaluate(uv_grid, face, lacing=Longest)
Normals = Output(evaluate_normal)
UVs = Output(uv_grid)
