# Dynamo custom node XYZ Z Less Than or Eq N.dyf (Dynamo 0.6.3.5258)
# category: buildz
# Checks if an XYZs Z  coordinate is Less Than or Equal to a number

xyz = Input()
xyz_z = XyzGetZ(xyz, lacing=Longest)
limit = Input()
less_than_or_equal = LessThanEquals(xyz_z, limit)
x_y = Output(less_than_or_equal)  # "x≤y"
