# Dynamo custom node Add Unique.dyf (Dynamo 0.6.1.18684)
# category: buildz
# given a list and a item, adds the item to the list if it isn't in there already

item = Input()
list = Input()
exists = Custom[Exists](Exists=item, Seq=list)  # checks if a given item exists in a given list
add_to_list = List(item, list)
if_ = Conditional(exists, list, add_to_list)
list_2 = Output(if_)  # "list"
