# Dynamo custom node Exists.dyf (Dynamo 0.6.1.18684)
# category: buildz
# checks if a given item exists in a given list

Exists = Input()  # "Exists?"
equal = Equal(arg1=Exists)
Seq = Input()
true_for_any = OrMap(equal, Seq)
