# Dynamo custom node remove duplicates.dyf (Dynamo 0.6.1.18684)
# category: Core.Lists
# removes duplicate data from a list

add_unique = Custom[Add Unique]()  # given a list and a item, adds the item to the list if it isn't in there already
empty_list = Empty()
list = Input()
reduce = Fold(add_unique, empty_list, list)
reverse = Reverse(reduce)
list_2 = Output(reverse)  # "list"
