# Dynamo graph groupsTestFile.dyn (Dynamo 2.15.0.4596)

# group: Group1
code_block = CodeBlock { inputNode; }  # unwired: inputNode
code_block_2 = CodeBlock(outputNode=code_block) { outputNode; }

# group: Group2
code_block_3 = CodeBlock {  }
code_block_4 = CodeBlock {  }

# group: GroupToCollapse
code_block_5 = CodeBlock { codeBlock1Input; }  # unwired: codeBlock1Input
code_block_6 = CodeBlock { codeBlock2Input; }  # unwired: codeBlock2Input
code_block_7 = CodeBlock(c=code_block_6) { c; }
code_block_8 = CodeBlock(x=code_block_5, y=code_block_7) { x; y; }
list_create = List.Create()  # unwired: item0, item1, item2

code_block_9 = CodeBlock { someInput; }  # unwired: someInput

# group: GroupWithGroupedGroup
code_block_10 = CodeBlock(input=code_block_9) { input; }
code_block_11 = CodeBlock(out=code_block_10) { out; }

# group: GroupWithGroupedGroup > GroupInsideOtherGroup
code_block_12 = CodeBlock(groupedInput=code_block_10) { groupedInput; }
code_block_13 = CodeBlock(groupedOut=code_block_12) { groupedOut; }

# group: CollapsedGroup
code_block_14 = CodeBlock { a; }  # unwired: a
code_block_15 = CodeBlock(s=code_block_14) { s; }

# note: PinnedNodes to be grouped in test
pinNode1 = CodeBlock { a; }  # unwired: a
pinNode2 = CodeBlock(b=pinNode1) { b; }

# group: OuterGroupCollapsed
byCenterPointRadius = Circle.ByCenterPointRadius()

code_block_16 = CodeBlock(data=byCenterPointRadius) { data; }

# group: OuterGroupCollapsed > InnerGroupExpanded
byCenterPointRadius_2 = Circle.ByCenterPointRadius()

code_block_17 = CodeBlock(data=byCenterPointRadius_2) { data; }

# group: OuterGroupCollapsed2 > InnerGroupCollapsed
byCenterPointRadius_3 = Circle.ByCenterPointRadius()

code_block_18 = CodeBlock(data=byCenterPointRadius_3) { data; }

# group: OuterGroupCollapsed2
byCenterPointRadius_4 = Circle.ByCenterPointRadius()

code_block_19 = CodeBlock(data=byCenterPointRadius_4) { data; }

# group: GroupWithGroupedGroup2
code_block_20 = CodeBlock(input=code_block_9) { input; }
code_block_21 = CodeBlock(out=code_block_20) { out; }

# group: GroupWithGroupedGroup2 > CollapsedGroupInside
code_block_22 = CodeBlock(groupedInput=code_block_20) { groupedInput; }
target = CodeBlock(groupedOut=code_block_22) { groupedOut; }
