# Dynamo graph complex.dyn (Dynamo 0.8.1.970)

n5 = CodeBlock(o1=n3.o1) { i1 = 1; c1 = o1; c2 = 1; }  # "5"
n4 = CodeBlock(o2=n3.o2) { i2= 1; c4 = o2; c5 = 1; }  # "4"
n3 = CodeBlock(i1=n5.c1, i2=n4.i2) { z = 1; o1= 1; o2 = 2; m = i1; n = i2; }  # "3"
n2 = CodeBlock(z=n3.z) { y = z; }  # "2"
n1 = CodeBlock(y=n2) { x = y; }  # "1"
n7 = CodeBlock(c2=n5.c2) { c3 = c2; }  # "7"
n6 = CodeBlock(c5=n4.c5) { c6 = c5; }  # "6"
n8 = CodeBlock { c7 = c8; }  # "8"
n9 = CodeBlock(c7=n8) { c8 = c7; }  # "9"
