# Dynamo graph linear.dyn (Dynamo 0.6.2.29058)

n4 = CodeBlock { n = 0; }  # "4"
n3 = CodeBlock(a=n2.a, n=n4) { t = a; m = 2; z = n; }  # "3"
n2 = CodeBlock(m=n3.m) { a = 1; b = m; }  # "2"
n1 = CodeBlock(a=n2.a) { x = a; }  # "1"
