# Dynamo graph multiinputs2.dyn (Dynamo 0.8.1.970)

n1 = CodeBlock { 1; }  # "1"
n2 = CodeBlock(y=n1) { x = y; }  # "2"
n3 = CodeBlock(b=n2) { a = b; }  # "3"
n4 = CodeBlock { 2; }  # "4"
n5 = CodeBlock(y=n4) { x = y; }  # "5"
n6 = CodeBlock(b=n5) { a = b; }  # "6"
n7 = CodeBlock { 3; }  # "7"
n8 = CodeBlock(y=n7) { x = y; }  # "8"
n9 = CodeBlock(b=n8) { a = b; }  # "9"
n10 = CodeBlock { 3; }  # "10"
n11 = CodeBlock(y=n10) { x = y; }  # "11"
n12 = CodeBlock(b=n11) { a = b; }  # "12"
n13 = CodeBlock(a=n3, b=n6, c=n9, d=n12) { x = a + b + c + d; }  # "13"
