# Dynamo graph multioutputs.dyn (Dynamo 1.0.1.1743)

n1 = CodeBlock { x = 1; }  # "1"
n2 = CodeBlock(x=n1) { a = x; }  # "2"
n3 = CodeBlock(x=n1) { b = x; }  # "3"
n4 = CodeBlock(x=n1) { c = x; }  # "4"
