# Dynamo graph nodes.dyn (Dynamo 0.6.2.32178)

number = DoubleInput(3)
code_block = CodeBlock { a = 1; }
number_2 = DoubleInput(1..10)
code_block_2 = CodeBlock(b=number_2) { x = b; }
cos = DSFunction(code_block_2)  # "Math.Cos"
