# Dynamo graph updateInputNodeModel.dyn (Dynamo 2.16.0.2070)

test_selection_node = TestSelectionNode()  # graph input
watch_image = WatchImageCore(image=test_selection_node)
code_block = CodeBlock { 2; }
pixels = Image.Pixels(image=watch_image, xSamples=code_block, ySamples=code_block)
code_block_2 = CodeBlock(a=pixels) { a[0][0]; }
red = Color.Red(color=code_block_2)
