# Dynamo graph atlevel_transpose.dyn (Dynamo 1.0.0.482)

code_block = CodeBlock { xs = {{{0..2, 3..5}, {6..8, 9..11}}}; }
code_block_2 = CodeBlock(xs=code_block) { List.Transpose(xs@-3<1>); }
code_block_3 = CodeBlock(xs=code_block_2) { xs[0]; }
