# Dynamo graph RebindingSingleDimension.dyn (Dynamo 3.0.0.5795)

string = StringInput("tywin")
string_2 = StringInput("cersei")
string_3 = StringInput("hodor")
join = List.Join(list0=string, list1=string_2, list2=string_3)
code_block = CodeBlock { 0..2; }
add = join + code_block
length = String.Length(string=add)
wrapperObject = FFITarget.WrapperObject.WrapperObject(x=length)
