# Dynamo custom node createObjectWrapperTrace.dyf (Dynamo 2.10.0.3136)
# category: tests
# some custom node that creates elements

x = Input(x: int)
wrapperObject = FFITarget.WrapperObject.WrapperObject(x=x)
WrapperObject = Output(wrapperObject)
