# Dynamo graph element_binding.dyn "element_binding2" (Dynamo 2.1.0.3965)

code_block = CodeBlock { 23; }
wrapperObject = FFITarget.WrapperObject.WrapperObject(x=code_block)
ID = FFITarget.WrapperObject.ID(wrapperObject=wrapperObject)
wrapperObject_2 = FFITarget.WrapperObject.WrapperObject(x=code_block)
ID_2 = FFITarget.WrapperObject.ID(wrapperObject=wrapperObject_2)
