# Dynamo graph element_binding_customNodes_modified_multiple.dyn (Dynamo 3.0.0.5795)

code_block = CodeBlock { 100; }
wrapperObject = FFITarget.WrapperObject.WrapperObject(x=code_block)
ID = FFITarget.WrapperObject.ID(wrapperObject=wrapperObject)
element_binding_nested = Custom[element_binding_nested](someInput=ID)  # testing nested element binding
ID_6 = FFITarget.WrapperObject.ID(wrapperObject=element_binding_nested.out2)  # "WrapperObject.ID_6"
ID_7 = FFITarget.WrapperObject.ID(wrapperObject=element_binding_nested.out1)  # "WrapperObject.ID_7"
element_binding_nested_2 = Custom[element_binding_nested](someInput=ID)
ID_11 = FFITarget.WrapperObject.ID(wrapperObject=element_binding_nested_2.out1)  # "WrapperObject.ID_11"
ID_10 = FFITarget.WrapperObject.ID(wrapperObject=element_binding_nested_2.out2)  # "WrapperObject.ID_10"
