# Dynamo graph element_binding_customNodes_modified_multiple_pre3.0.dyn "element_binding_customNodes_modified_multiple" (Dynamo 2.2.0.4565)

code_block = CodeBlock { 100; }
wrapperObject = FFITarget.WrapperObject.WrapperObject(x=code_block)
ID = FFITarget.WrapperObject.ID(wrapperObject=wrapperObject)
element_binding_nested = Custom[element_binding_nested](someInput=ID)  # testing nested element binding
ID_111111 = FFITarget.WrapperObject.ID(wrapperObject=element_binding_nested.out2)  # "WrapperObject.ID_111111"
ID_222222 = FFITarget.WrapperObject.ID(wrapperObject=element_binding_nested.out1)  # "WrapperObject.ID_222222"
element_binding_nested_2 = Custom[element_binding_nested](someInput=ID)
ID_444444 = FFITarget.WrapperObject.ID(wrapperObject=element_binding_nested_2.out1)  # "WrapperObject.ID_444444"
ID_333333 = FFITarget.WrapperObject.ID(wrapperObject=element_binding_nested_2.out2)  # "WrapperObject.ID_333333"
