# Dynamo graph element_binding_customNodes_replication.dyn (Dynamo 2.10.0.3136)

code_block = CodeBlock { 0..5; }
createObjectWrapperTrace = Custom[createObjectWrapperTrace](x=code_block)  # some custom node that creates elements
ID = FFITarget.WrapperObject.ID(wrapperObject=createObjectWrapperTrace)
