# Dynamo graph element_binding_customNodes_replication2d.dyn (Dynamo 2.10.0.3220)

code_block = CodeBlock { 0..5; }
range = Range(end=code_block)
createObjectWrapperTrace = Custom[createObjectWrapperTrace](x=range)  # some custom node that creates elements
ID = FFITarget.WrapperObject.ID(wrapperObject=createObjectWrapperTrace)
