# Dynamo graph element_binding_large.dyn (Dynamo 3.0.0.5795)

code_block = CodeBlock { 0..1500; }
wrapperObject = FFITarget.WrapperObject.WrapperObject(x=code_block)
ID = FFITarget.WrapperObject.ID(wrapperObject=wrapperObject)
