# Dynamo custom node element_binding_nested.dyf (Dynamo 2.2.0.4516)
# category: testing
# testing nested element binding

someInput = Input(someInput: var[]..[])
wrapperObject = FFITarget.WrapperObject.WrapperObject(x=someInput)
out2 = Output(wrapperObject)
wrapperObject_2 = FFITarget.WrapperObject.WrapperObject(x=someInput)
out1 = Output(wrapperObject_2)
