# Dynamo graph func_nested_replication.dyn (Dynamo 2.10.0.3220)

code_block = CodeBlock()
# ---------- code_block.designscript (5 lines) ----------
def internalReplication(x){
y = 0..x;
data = WrapperObject.WrapperObject(y);
return data;
};
# ----------------------------------------
inner_replicating = CodeBlock { x = 2; internalReplication(x); }
id1 = FFITarget.WrapperObject.ID(wrapperObject=inner_replicating.out1)
both_replicating = CodeBlock(wait=id1) { wait; internalReplication(0..3); }
id2 = FFITarget.WrapperObject.ID(wrapperObject=both_replicating.out1)
