# Dynamo graph nonNestedWorking_replication.dyn (Dynamo 2.10.0.3150)

code_block = CodeBlock { 0..5; }
wrapperObject = FFITarget.WrapperObject.WrapperObject(x=code_block)
ID = FFITarget.WrapperObject.ID(wrapperObject=wrapperObject)
