# Dynamo graph trace_test-prebinding.dyn "trace_test" (Dynamo 3.0.0.6191)

code_block = CodeBlock { 12; }
incrementerTracedClass = FFITarget.IncrementerTracedClass.IncrementerTracedClass(x=code_block)
wasCreatedWithTrace = FFITarget.IncrementerTracedClass.WasCreatedWithTrace(incrementerTracedClass=incrementerTracedClass)
