# Dynamo graph TestDictionaryListSyntax.dyn (Dynamo 2.0.0.2821)

code_block = CodeBlock { {"foo": "bar"}; }
watch = Watch(code_block)
code_block_2 = CodeBlock { {}; }
watch_2 = Watch(code_block_2)
code_block_3 = CodeBlock { b = {"foo": "bar"}; }
watch_3 = Watch(code_block_3)
code_block_4 = CodeBlock { []; }
watch_4 = Watch(code_block_4)
code_block_5 = CodeBlock()
# ---------- code_block_5.designscript (3 lines) ----------
[Imperative]{
	return [1,2];
};
# ----------------------------------------
watch_5 = Watch(code_block_5)
code_block_6 = CodeBlock { [1,2]; }
watch_6 = Watch(code_block_6)
code_block_7 = CodeBlock()
# ---------- code_block_7.designscript (3 lines) ----------
[Imperative]{
	[1,2];
};
# ----------------------------------------
watch_7 = Watch(code_block_7)
code_block_8 = CodeBlock()
# ---------- code_block_8.designscript (3 lines) ----------
[Imperative]{
	{"foo" : "bar" };
};
# ----------------------------------------
watch_8 = Watch(code_block_8)
code_block_9 = CodeBlock()
# ---------- code_block_9.designscript (3 lines) ----------
[Imperative]{
	return {"foo" : "bar"};
};
# ----------------------------------------
watch_9 = Watch(code_block_9)
code_block_10 = CodeBlock { {1,2}; }
code_block_11 = CodeBlock { { foo: "bar" }; }
