# Dynamo graph magn592.dyn (Dynamo 0.6.2.17554)

code_block = CodeBlock { a=1..10; }
count = DSFunction(code_block)
code_block_2 = CodeBlock { b = (1..10..1)..5; }
flatten = DSFunction(code_block_2)
count_2 = DSFunction(flatten)
add = DSFunction(count, count_2)
