# Dynamo graph TestImperativeArrayIndexing.dyn (Dynamo 0.9.1.3340)

code_block = CodeBlock()
# ---------- code_block.designscript (9 lines) ----------
arr = {{{1, 2}, {3, 4}}, {{5, 6}, {7, 8}}};
d1 = 1;
d2 = 0;
d3 = 1;
x = [Imperative]
{
    element = arr[d1][d2][d3];
    return = element;
};
# ----------------------------------------
watch = Watch(code_block.out4)
