# Dynamo graph TestImperativeExpressionList.dyn (Dynamo 0.9.1.3340)

code_block = CodeBlock()
# ---------- code_block.designscript (9 lines) ----------
arr = {2, 3, 5, 7, 11, 13, 17};
d1 = 2;
d2 = 4;
d3 = 6;
d4 = 21;
[Imperative]
{
    return = {arr[d1], arr[d2], arr[d3], d4};
};
# ----------------------------------------
watch = Watch(code_block.out5)
