# Dynamo graph TestImperativeForLoop.dyn (Dynamo 0.9.1.3340)

code_block = CodeBlock()
# ---------- code_block.designscript (13 lines) ----------
n = 10;
sum = 0;

r = [Imperative]
{
    for (x in 1..n)
    {
        sum = sum + x;
    }
    return = null;
}

v = sum;
# ----------------------------------------
watch = Watch(code_block.out3)
