# Dynamo graph TestImperativeFunctionParameter.dyn (Dynamo 0.9.1.3340)

code_block = CodeBlock()
# ---------- code_block.designscript (17 lines) ----------
def foo(a, b, c, d)
{
    return = a * b * c * d;
}

a = 3;
b = 5;
c = 7;
fptr = foo;

r = [Imperative]
{
    d = 11;
    v1 = fptr(a, b, c, 2);
    v2 = foo(a, b, c, 4);
    return = v1 + v2;
};
# ----------------------------------------
watch = Watch(code_block.out4)
