# Dynamo graph TestImperativeIf.dyn (Dynamo 0.9.1.3340)

code_block = CodeBlock()
# ---------- code_block.designscript (14 lines) ----------
a = true;
b = 21;
c = 42;
r = [Imperative]
{
    if (a)
    {
        return = b;
    }
    else
    {
        return = c;
    }
};
# ----------------------------------------
watch = Watch(code_block.out3)
