# Dynamo graph TestImperativePropertyAccessing.dyn (Dynamo 0.9.1.3340)

code_block = CodeBlock()
# ---------- code_block.designscript (5 lines) ----------
X = Autodesk.Point.ByCoordinates(21, 21, 21);
Y = [Imperative]
{
    return = X.X;
};
# ----------------------------------------
watch = Watch(code_block.out1)
