# Dynamo graph TestImperativeWhileLoop.dyn (Dynamo 0.9.1.3340)

code_block = CodeBlock()
# ---------- code_block.designscript (14 lines) ----------
a = 1;
sum = 0;

r = [Imperative]
{
    while (a <= 10)
    {
        sum = sum + a;
        a = a + 1;
    }
    return = sum;
}

x = sum;
# ----------------------------------------
watch = Watch(code_block.out3)
