# Dynamo graph TestReplicationGuidesWithASTRewrite.dyn (Dynamo 1.3.0.875)

code_block = CodeBlock { ReplicationX.sum(ReplicationX.ReplicationX(), DummyCollection.ReturnIList({1,2,3})<1>, DummyCollection.ReturnIList({10,20,30})<2>); }
code_block_2 = CodeBlock { DummyCollection.ReturnIList({1,2,3})<1> + DummyCollection.ReturnIList({4,5,6})<2>; }
