# Dynamo graph collapse-function.dyn (Dynamo 0.6.2.23503)

number = DoubleInput(0)
number_2 = DoubleInput(0)
add = Addition(number, number_2, lacing=Longest)
multiply = Multiplication(number, add, lacing=Longest)
