# Dynamo graph collapse-group.dyn (Dynamo 2.19.0.4737)

# group: Test > Input
number = DoubleInput(5)  # graph input
number_2 = DoubleInput(4)  # graph input

# group: Test > Action
add = number + number_2  # lacing=Longest
add_2 = add + number_2  # lacing=Longest
mul = add_2 * number  # lacing=Longest

# group: Test
# note: Test Note in Group
watch = Watch(mul)
