# Dynamo graph collapse-number-chain.dyn (Dynamo 0.6.3.20352)

number = DoubleInput(60)
number_2 = DoubleInput(50)
number_3 = DoubleInput(40)
number_4 = DoubleInput(30)
number_5 = DoubleInput(20)
number_6 = DoubleInput(10)
add = Addition(number_5, number_6, lacing=Longest)
add_2 = Addition(number_4, add, lacing=Longest)
add_3 = Addition(number_3, add_2, lacing=Longest)
add_4 = Addition(number_2, add_3, lacing=Longest)
add_5 = Addition(number, add_4, lacing=Longest)
