# Dynamo graph collapse.dyn (Dynamo 0.6.3.20068)

number = DoubleInput(5)
number_2 = DoubleInput(4)
add = Addition(number, number_2, lacing=Longest)
add_2 = Addition(add, number_2, lacing=Longest)
multiply = Multiplication(add_2, number, lacing=Longest)
watch = Watch(multiply)
