# Dynamo custom node Sequence2.dyf (Dynamo 1.0.1.1743)
# category: Misc

start = Input()
end = Input()
formula = Formula("x-1", x=end)
step = Input()
range = Range(start=start, end=formula, step=step)
Output = Output(range)  # ""
