# Dynamo custom node Sequence_Json.dyf "Sequence2" (Dynamo 3.0.0.5795)
# category: Misc
# test node

start = Input(start: var[]..[])
end = Input(end: var[]..[])
formula = CodeBlock(x=end) { temp_proc_var_ = x - 1; }
step = Input(step: var[]..[])
range = Range(start=start, end=formula, step=step)
Output = Output(range)  # ""
