# Dynamo graph FFITarget.dyn (Dynamo 2.2.0.3675)

code_block = CodeBlock { 2; }
byCoordinates = FFITarget.DummyPoint2D.ByCoordinates(x=code_block, y=code_block)
X = FFITarget.DummyPoint2D.X(dummyPoint2D=byCoordinates)
Y = FFITarget.DummyPoint2D.Y(dummyPoint2D=byCoordinates)
