# Dynamo graph GeometryTest.dyn "test" (Dynamo 2.0.1.4714)

code_block = CodeBlock { -10; }
byCoordinates = Point.ByCoordinates(x=code_block, y=code_block, z=code_block)
code_block_2 = CodeBlock { 10; }
byCoordinates_2 = Point.ByCoordinates(x=code_block_2, y=code_block_2, z=code_block_2)
byStartPointEndPoint = Line.ByStartPointEndPoint(startPoint=byCoordinates, endPoint=byCoordinates_2)
customCube = Custom[CustomCube]()  # Test
code_block_3 = CodeBlock { 255; 50; 100; 200; }
byARGB = Color.ByARGB(a=code_block_3.out0, r=code_block_3.out1, g=code_block_3.out2, b=code_block_3.out3)
byGeometryColor = Modifiers.GeometryColor.ByGeometryColor(geometry=customCube, color=byARGB)
code_block_4 = CodeBlock { 15; }
byCoordinates_3 = Point.ByCoordinates(x=code_block_4, y=code_block_4, z=code_block_4)
byLengths = Cuboid.ByLengths(origin=byCoordinates_3)
byGeometryColor_2 = Modifiers.GeometryColor.ByGeometryColor(geometry=byLengths, color=byARGB)
