# Dynamo graph addmultwithstatesindyn.dyn (Dynamo 0.8.2.1605)

code_block = CodeBlock { 0.5; }
number = DoubleInput(0)
mul = code_block * number
number_slider = DoubleSlider(20, range=0..20 step 0.1)
add = mul + number_slider
