# Dynamo graph multipleDeps.dyn (Dynamo 2.2.0.3675)

code_block = CodeBlock { 2; }
byCoordinates = FFITarget.DummyPoint2D.ByCoordinates(x=code_block, y=code_block)
X = FFITarget.DummyPoint2D.X(dummyPoint2D=byCoordinates)
Y = FFITarget.DummyPoint2D.Y(dummyPoint2D=byCoordinates)
code_block_2 = CodeBlock(x=X, y=Y) { x+y; }
create = Examples.NEWBasicExample.Create(x=code_block_2, y=code_block, z=code_block)
point = Examples.NEWBasicExample.Point(nEWBasicExample=create)
string_from_object = FromObject(obj=point)
