# Dynamo graph polycurveDirection.dyn (Dynamo 3.3.0.6046)

code_block = CodeBlock()
# ---------- code_block.designscript (5 lines) ----------
a = Point.ByCoordinates(0,0,0);
b = Point.ByCoordinates(1,0,0);
c = Point.ByCoordinates(2,0,0);
l = [Line.ByStartPointEndPoint(b, a),
Line.ByStartPointEndPoint(b, c)];
# ----------------------------------------
byJoinedCurves = PolyCurve.ByJoinedCurves(curves=code_block.l)
startPoint = Curve.StartPoint(curve=byJoinedCurves)
X = Point.X(point=startPoint)
watch = Watch(X)
