# Dynamo graph simplelists.dyn (Dynamo 0.8.2.2073)

byCorners = Cuboid.ByCorners()
explode = Geometry.Explode(byCorners)
code_block = CodeBlock { 1000; }
code_block_2 = CodeBlock(x=code_block)
# ---------- code_block_2.designscript (2 lines) ----------
{x,2,3,
{1,2,3}};
# ----------------------------------------
