# Dynamo custom node ExpectedResultCustomNodeFile.dyf "Circle" (Dynamo 0.7.6.3454)
# category: Builtin Functions

byCoordinates = Point.ByCoordinates(lacing=Longest)
Radius = Input(lacing=Longest)
byCenterPointRadius = Circle.ByCenterPointRadius(byCoordinates, Radius, lacing=Longest)
byPatch = Surface.ByPatch(byCenterPointRadius, lacing=Longest)
Filled_circle = Output(byPatch, lacing=Longest)
