# Dynamo graph TestHome.dyn (Dynamo 0.7.6.3454)

code_block = CodeBlock { 0..10..3; }
byCoordinates = Point.ByCoordinates(code_block, lacing=Longest)
boolean = BoolSelector(true)
number = DoubleInput(2)
number_2 = DoubleInput(0)
if_ = If(boolean, number, number_2)
byCenterPointRadius = Sphere.ByCenterPointRadius(byCoordinates, if_, lacing=Longest)
