# Dynamo custom node Fibonacci.dyf (Dynamo 0.7.4.3191)
# category: Ian

list = Input()
count = List.Count(list)
code_block = CodeBlock(count=count) { count-2; }
getItemAtIndex = List.GetItemAtIndex(list, code_block)
lastItem = List.LastItem(list)
add = getItemAtIndex + lastItem
addItemToEnd = List.AddItemToEnd(add, list)
fibonacci_series = Output(addItemToEnd)
