# Dynamo graph LoopWhile_Fibonacci.dyn (Dynamo 0.7.4.3221)

code_block = CodeBlock { {0,1}; }
code_block_2 = CodeBlock { 10; }
lastItemLessThan = Custom[LastItemLessThan](lessThan=code_block_2)
fibonacci = Custom[Fibonacci]()
loopWhile = LoopWhile(code_block, lastItemLessThan, fibonacci)
