# Dynamo graph Sum_LoopWhile.dyn (Dynamo 0.7.4.3192)

code_block = CodeBlock { 0; }
code_block_2 = CodeBlock { 5; }
lt = _ < code_block_2
code_block_3 = CodeBlock { 1; }
add = code_block_3 + _
loopWhile = LoopWhile(code_block, lt, add)
