# Dynamo graph compose_order.dyn (Dynamo 0.7.0.27567)

code_block = CodeBlock { 10; }
add = code_block + _
code_block_2 = CodeBlock { 5; }
mul = code_block_2 * _
compose = ComposeFunctions(add, mul)  # "Function.Compose"
apply = ApplyFunction(compose, code_block_2)  # "Function.Apply"
