# Dynamo custom node GraphFunction.dyf (Dynamo 1.0.1.1743)
# category: Logic.Math

number = DoubleInput(0)
byCoordinates = Point.ByCoordinates(z=number, lacing=Longest)
x_start = Input()  # "x-start"
x_end = Input()  # "x-end"
x_step = Input()  # "x-step"
range = Range(start=x_start, end=x_end, step=x_step, lacing=Longest)
y = Input(y = f(x))
map = List.Map(list=range, f_x=y)
combine = List.Combine(byCoordinates, range, map)
