# Dynamo graph begin-test.dyn (Dynamo 0.6.3.24633)

string = StringInput("test.txt")
write_file = FileWriter(string, string)
read_text_file = FileReader(string)
perform_all = Begin(expr1=write_file, expr2=read_text_file)
watch = Watch(perform_all)
