# Dynamo graph if-test.dyn (Dynamo 0.6.3.24633)

number = DoubleInput(0)
formula = Formula("x!=0", x=number, lacing=Longest)
number_2 = DoubleInput(50)
divide = Division(number_2, number, lacing=Longest)
string = StringInput("can't divide by 0")
if_ = Conditional(formula, divide, string)
watch = Watch(if_)
