# Dynamo graph defaultArgumentAdded3.dyn (Dynamo 2.0.0.4752)

createDefaultArguments = FFITarget.DefaultArguments.CreateDefaultArguments()
code_block = CodeBlock { 1; }
instanceFooBar = FFITarget.DefaultArguments.InstanceFooBar(createDefaultArguments, code_block)
