# Dynamo graph defaultArgumentDisabled.dyn (Dynamo 0.8.1.1372)

byCenterPointRadius = Sphere.ByCenterPointRadius()
code_block = CodeBlock { Point.ByCoordinates(5,5,5); 5; }
apply = ApplyFunction(byCenterPointRadius, code_block.out0, code_block.out1)  # "Function.Apply"
code_block_2 = CodeBlock { 1..#5..2; }
byCoordinates = Point.ByCoordinates()
byCenterPointRadius_2 = Sphere.ByCenterPointRadius(centerPoint=byCoordinates)
map = List.Map(list=code_block_2, f_x=byCenterPointRadius_2)
code_block_3 = CodeBlock { Point.ByCoordinates(1..#10..1, 0); }
byCenterPointRadius_3 = Sphere.ByCenterPointRadius()
map_2 = List.Map(list=code_block_3, f_x=byCenterPointRadius_3)
