# Dynamo graph defaultValueAttributeForDummyLine.dyn (Dynamo 0.8.0.683)

byStartPointEndPointWithDefault = FFITarget.DummyLine.ByStartPointEndPointWithDefault()
end = FFITarget.DummyLine.End(byStartPointEndPointWithDefault)
X = FFITarget.DummyPoint.X(end)
