# Dynamo graph defaultValueAttributeTest.dyn (Dynamo 0.8.0.682)

getCircleArea = FFITarget.TestData.GetCircleArea()
code_block = CodeBlock { 2.5; }
getCircleArea_2 = FFITarget.TestData.GetCircleArea(code_block)
equals = Equals(getCircleArea, getCircleArea_2)
