# Dynamo graph defaultValueInFunctionObject.dyn (Dynamo 0.7.5.3281)

code_block = CodeBlock { 1..2; }
byCoordinates = Point.ByCoordinates(code_block)
code_block_2 = CodeBlock { 1; }
translate = Geometry.Translate(arg2=code_block_2)
map = List.Map(byCoordinates, translate)
Y = Point.Y(map)
