# Dynamo graph invalidDefaultArgument.dyn (Dynamo 0.8.0.710)

multiplyBy3NonParsableDefaultArgument = FFITarget.TestData.MultiplyBy3NonParsableDefaultArgument()
code_block = CodeBlock { 4; }
apply = ApplyFunction(multiplyBy3NonParsableDefaultArgument, code_block)  # "Function.Apply"
