# Dynamo graph take-every-default.dyn (Dynamo 1.0.1.1743)

number = DoubleInput(0..20)
number_2 = DoubleInput(2)
takeEveryNthItem = List.TakeEveryNthItem(number, number_2)
watch = Watch(takeEveryNthItem)
