# Dynamo graph defineDataTest.dyn (Dynamo 3.1.0.3411)

integer_slider = IntegerSlider(1, range=0..100 step 1)
defineData = DefineData("Boolean", integer_slider, IsAutoMode=false, IsList=false, DisplayValue="Boolean")
defineData_2 = DefineData("Integer", integer_slider, IsAutoMode=true, IsList=false, DisplayValue="Integer")
code_block = CodeBlock { 5; 10; }
byWidthLength = Rectangle.ByWidthLength(width=code_block.out0, length=code_block.out1)
code_block_2 = CodeBlock { Point.ByCoordinates(0,0,0); Point.ByCoordinates(2.5,5,0); }
byStartPointEndPoint = Line.ByStartPointEndPoint(startPoint=code_block_2.out0, endPoint=code_block_2.out1)
heterogeneous_list = List.Create(item0=byWidthLength, item1=byStartPointEndPoint)
definedata_ok = DefineData("Curve", heterogeneous_list, IsAutoMode=true, IsList=true, DisplayValue="Curve")
non_confirming_list = List.Create(item0=byWidthLength, item1=byStartPointEndPoint, item2=code_block.out1)
definedata_error = DefineData("Curve", non_confirming_list, IsAutoMode=true, IsList=false, DisplayValue="Select Types")
