# Dynamo graph AcceptArbitraryDict.dyn (Dynamo 2.1.0.7151)

returnArbitraryDictionary = FFITarget.DummyCollection.ReturnArbitraryDictionary()
acceptNestedDictionary = FFITarget.DummyCollection.AcceptNestedDictionary(dictionary=returnArbitraryDictionary)
acceptIDictionary = FFITarget.DummyCollection.AcceptIDictionary(dictionary=returnArbitraryDictionary)
