# Dynamo graph Dictionary.Values2.dyn (Dynamo 2.19.0.5164)

code_block = CodeBlock { {"a":"foo"}; }
values = DesignScript.Builtin.Dictionary.Values(dictionary=code_block)
code_block_2 = CodeBlock { ["a", "b"]; [1,[1,2]]; }
byKeysValues = DesignScript.Builtin.Dictionary.ByKeysValues(keys=code_block_2.out0, values=code_block_2.out1)
values_2 = DesignScript.Builtin.Dictionary.Values(dictionary=byKeysValues)
code_block_3 = CodeBlock { "a".."z"; 1..26; }
byKeysValues_2 = DesignScript.Builtin.Dictionary.ByKeysValues(keys=code_block_3.out0, values=code_block_3.out1)
values_3 = DesignScript.Builtin.Dictionary.Values(dictionary=byKeysValues_2)
watch = Watch(values_3)
