# Dynamo custom node TestNodeNotInPackage.dyf (Dynamo 3.0.0.5795)
# category: Layer
# Test node that does not belong to a package

Input = Input(: var[]..[])
Input_2 = Input(: var[]..[])
Input_3 = Input(: var[]..[])
Input_4 = Input(: var[]..[])
heat_series_plot = HeatSeriesNodeModel(x_labels=Input, y_labels=Input_2, values=Input_3, colors=Input_4)
