# Dynamo graph CustomFunctionobject_3483.dyn (Dynamo 0.7.1.17276)

number = DoubleInput(-3..3)
pass_nothing_below_1 = Custom[Pass Nothing Below 1]()  # Takes inputs and only passes 1 or values above 1
map = List.Map(number, pass_nothing_below_1)
watch = Watch(map)
