# Dynamo graph DefaultValue.dyn (Dynamo 1.0.1.1743)

identity = CoordinateSystem.Identity()
number_slider = DoubleSlider(5, range=0..100 step 0.1)
byCoordinates = Vector.ByCoordinates(x=number_slider, y=number_slider, z=number_slider)
translate = CoordinateSystem.Translate(identity, byCoordinates)
origin = CoordinateSystem.Origin(translate)
X = Point.X(origin)
