# Dynamo graph Defect_MAGN_2479.dyn (Dynamo 0.7.0.26875)

code_block = CodeBlock { 1..20; }
code_block_2 = CodeBlock { 1; }
code_block_3 = CodeBlock { 8; }
code_block_4 = CodeBlock { 2; }
slice = List.Slice(code_block, code_block_2, code_block_3, code_block_4)
