# Dynamo graph Defect_MAGN_3264.dyn (Dynamo 0.7.0.19565)

code_block = CodeBlock { zs = {0, 1, 2, 3, 4}; }
byCoordinates = Point.ByCoordinates(arg2=code_block, lacing=Longest)
Z = Point.Z(byCoordinates)
