# Dynamo graph IfAsFunctionobject_3483.dyn (Dynamo 0.7.1.17276)

number = DoubleInput(-2..2)
number_2 = DoubleInput(1)
if_ = If(arg1=number_2, arg2=number)
map = List.Map(number, if_)
watch = Watch(map)
