# Dynamo graph IfOutputCustomFunction_3483.dyn (Dynamo 0.7.1.17276)

number = DoubleInput(-2..2)
code_block = CodeBlock { 1; }
lt = _ < code_block
# note: Output here is a function object of <
pass_nothing_below_1 = Custom[Pass Nothing Below 1](x=lt)  # Takes inputs and only passes 1 or values above 1
map = List.Map(number, pass_nothing_below_1)
watch = Watch(map)
