# Dynamo graph IfinputFunctionObject_3483.dyn (Dynamo 0.7.1.17276)

pass_nothing_below_1 = Custom[Pass Nothing Below 1]()  # Takes inputs and only passes 1 or values above 1
number = DoubleInput(1)
double_slider = DoubleSlider(2.352, range=-5..5)
if_ = If(pass_nothing_below_1, number, double_slider)
watch = Watch(if_)
