# Dynamo graph MigrateCBN.dyn (Dynamo 1.2.3.466)

file_path = Filename("..\..\..\test\core\dsevaluation\New Text Document.txt")
code_block = CodeBlock { {"a, 1", "b, 2"}; }
code_block_2 = CodeBlock(t1=file_path, t2=code_block) { t3 = CSV.WriteToFile(t1, t2); }
