# Dynamo custom node NestedIFNoRecursion.dyf (Dynamo 0.7.1.17276)
# category: CustomNode

x = Input()
y = Input()
lt = x < y
code_block = CodeBlock { 2; }
mod = x % code_block
code_block_2 = CodeBlock { 0; }
eq = mod == code_block_2
code_block_3 = CodeBlock { "Even"; }
code_block_4 = CodeBlock { "Odd"; }
if_ = If(eq, code_block_3, code_block_4)
if_2 = If(lt, if_, x)
test = Output(if_2)
