# Dynamo custom node NestedIFRecursion.dyf (Dynamo 0.7.1.16790)
# category: testCN

x = Input()
code_block = CodeBlock(x=x) { x+1; }
y = Input()
lt = code_block < y
code_block_2 = CodeBlock(x=x) { x+1; }
nestedIFRecursion = Custom[NestedIFRecursion](x=code_block_2, y=y)
code_block_3 = CodeBlock(x=x) { x+1; }
scopeIf = ScopedIf(lt, nestedIFRecursion, code_block_3)
code_block_4 = CodeBlock { 2; }
mod = scopeIf % code_block_4
code_block_5 = CodeBlock { 0; }
eq = mod == code_block_5
code_block_6 = CodeBlock { "even"; }
code_block_7 = CodeBlock { "Odd"; }
scopeIf_2 = ScopedIf(eq, code_block_6, code_block_7)
result = Output(scopeIf_2)
