# Dynamo custom node NestedIFRecursionMultiple.dyf (Dynamo 0.7.1.17276)
# category: testCN

x = Input()
code_block = CodeBlock { 2; }
mod = x % code_block
code_block_2 = CodeBlock { 0; }
eq = mod == code_block_2
code_block_3 = CodeBlock(x=x) { x+2; }
y = Input()
nestedIFRecursionMultiple = Custom[NestedIFRecursionMultiple](x=code_block_3, y=y)
code_block_4 = CodeBlock { x+1; }
nestedIFRecursionMultiple_2 = Custom[NestedIFRecursionMultiple](x=code_block_4, y=y)
if_ = If(eq, nestedIFRecursionMultiple, nestedIFRecursionMultiple_2)
result = Output(if_)
lt = x < y
if_2 = If(lt, eq, x)
