# Dynamo graph NestedIFRecursion_4058.dyn (Dynamo 0.7.1.17276)

code_block = CodeBlock { 1; }
code_block_2 = CodeBlock { 10; }
nestedIFRecursion = Custom[NestedIFRecursion](x=code_block, y=code_block_2)
watch = Watch(nestedIFRecursion)
