# Dynamo graph Nested_Language_Blocks.dyn (Dynamo 2.14.0.4185)

code_block2 = CodeBlock()
# ---------- code_block2.designscript (17 lines) ----------
a = 1;
b = 0..4;

i = [Imperative]
{
	c=0;
    while(a < 2)
    {

        [Associative]
        {
            c = a*b;
        }
        a = a+0.5;
    }
    return [c,a];
};
# ----------------------------------------
code_block3 = CodeBlock()
# ---------- code_block3.designscript (16 lines) ----------
a = [Associative]
{
	return [Imperative]
	{
		b = 0..4;
		return [Associative]
		{

			v = [Imperative]
		    {
				return 3;
		    }
		    return v*b;
		}
	}
};
# ----------------------------------------
code_block4 = CodeBlock()
# ---------- code_block4.designscript (23 lines) ----------
a = 1;
i = [Imperative]
{

	c = 0;
	b = 0..4;

    while(a < 2)
    {
        [Associative]
        {
        	v = [Imperative]
            {
				z = 3;
				return z;
            }
            c = v*b;

        }
        a = a+0.5;
    }
    return [c,a];
};
# ----------------------------------------
code_block5 = CodeBlock()
# ---------- code_block5.designscript (15 lines) ----------
a = 1;

c = [Imperative]
{
    x = [Associative]
    {
    	b = 0..3;
        return 2*b;
    }
    for(i in x)
    {
    	a = a+i;
    }
    return a;
};
# ----------------------------------------
code_block6 = CodeBlock()
# ---------- code_block6.designscript (12 lines) ----------
c = 323;
a = 2+c;
i = [Imperative]
{
	x = c;
	c = [Associative]
	{
		c = 209;
		return c+1;
	};
	return [x,c,a];
};
# ----------------------------------------
code_block7 = CodeBlock()
# ---------- code_block7.designscript (19 lines) ----------
a = 1;
b = 2;
i = [Imperative]
{
	c = 0;
	b = 0..4;

    while(a < 2)
    {

        [Associative]
        {

            c = 2*b;
        }
        a = a+0.2;
    }
    return [c,a];
};
# ----------------------------------------
code_block1 = CodeBlock()
# ---------- code_block1.designscript (17 lines) ----------
a = 1;
x = 3;
i = [Imperative]
{
	c = 0;
	b = 0..4;

    while(a < 2)
    {
        [Associative]
        {
            c = x*b;
        }
        a = a+0.2;
    }
    return [c,a];
};
# ----------------------------------------
code_block8 = CodeBlock()
# ---------- code_block8.designscript (21 lines) ----------
a = 1;
x = 3;
i = [Imperative]
{
	c = 0;
	b = 0..4;

    while(a < 2)
    {
        [Associative]
        {
        	v = [Imperative]
        	{
            	return a;
            }
            c = v*b;
        }
        a = a+0.2;
    }
    return [c,a];
};
# ----------------------------------------
