# Dynamo graph Overflow.dyn (Dynamo 2.9.0.2405)

ds_sub_overflow = CodeBlock { subOF = -9223372036854775807 - 9223372036854775807; }
ds_mul_overflow = CodeBlock { mulOF = 9223372036854775807 * 2; }
ds_neg_overflow = CodeBlock()
# ---------- ds_neg_overflow.designscript (4 lines) ----------
// Cannot define min long constant in DS
nextMin = -9223372036854775807;
min = nextMin - 1;
negOF = min - 1;
# ----------------------------------------
math_abs_overflow = Math.Abs(number=ds_neg_overflow.min)
code_block = CodeBlock { doubleBiggerThanMax = 9.3e18; }
math_ceiling_overflow = Math.Ceiling(number=code_block)
ds_sum_overflow = CodeBlock { max = 9223372036854775807; sumOF = max + max; }
math_factorial_overflow = Math.Factorial(number=ds_sum_overflow.max)
math_floor_overflow = Math.Floor(number=code_block)
