# Dynamo custom node Pass+Nothing+Below+1.dyf "Pass Nothing Below 1" (Dynamo 1.0.1.1743)
# category: buildz
# Takes inputs and only passes 1 or values above 1

x = Input()
number = DoubleInput(1)
lessThan = Compare.LessThan(x, number)
if_ = If(test=lessThan, true=number, false=x)
