# Dynamo graph Replication_EmptySublist.dyn (Dynamo 2.0.2.6826)

code_block = CodeBlock { 1; }
byCenterPointRadius = Circle.ByCenterPointRadius(radius=code_block)
code_block_2 = CodeBlock(c=byCenterPointRadius) { [[],[c]]; }
length = Curve.Length(curve=code_block_2)
