# Dynamo custom node SingleIFRecursion.dyf (Dynamo 0.7.1.16790)
# category: CustomNode

a = Input()
code_block = CodeBlock(a=a) { a+1; }
code_block_2 = CodeBlock(a=code_block) { a<5; }
code_block_3 = CodeBlock(a=a) { a+1; }
singleIFRecursion = Custom[SingleIFRecursion](a=code_block_3)
scopeIf = ScopedIf(code_block_2, singleIFRecursion, a)
