# Dynamo graph SingleIFRecursion.dyn (Dynamo 0.7.1.17276)

code_block = CodeBlock { n=1; }
create = List.Create(code_block)
count = Count(create)
code_block_2 = CodeBlock { 1; }
addItemToEnd = List.AddItemToEnd(code_block_2, create)
code_block_3 = CodeBlock(cn=count) { a={cn,cn-1}; }
getItemAtIndex = List.GetItemAtIndex(addItemToEnd, code_block_3)
if_ = If(count, addItemToEnd, getItemAtIndex)
code_block_4 = CodeBlock { 1; }
eq = count == code_block_4
if_2 = If()
code_block_5 = CodeBlock { 1; }
eq_2 = create == code_block_5
