# Dynamo graph TestCallingStaticMethod.dyn (Dynamo 0.9.1.3262)

code_block = CodeBlock { p = Autodesk.Point.ByCoordinates(1, 1, 1); v = Vector.ByCoordinates(4, 4, 4); pt2 = Autodesk.Point.Add(p, v); }
X = Point.X(code_block.pt2)
watch = Watch(X)
