# Dynamo graph TestDefaultArgumentExpressionResolution.dyn (Dynamo 0.8.2.1592)

code_block = CodeBlock { 1; }
code_block_2 = CodeBlock { 2; }
code_block_3 = CodeBlock { 3; }
XYZ = FFITarget.DesignScript.Point.XYZ(code_block, code_block_2, code_block_3)
byCenterPointRadius = Sphere.ByCenterPointRadius()
byCenterPointRadius_2 = Circle.ByCenterPointRadius()
extrude = Curve.Extrude(curve=byCenterPointRadius_2)
