# Dynamo graph TestNestedIfNoRecursion_4058_2.dyn (Dynamo 0.7.1.17276)

code_block = CodeBlock { 1; }
code_block_2 = CodeBlock { 5; }
nestedIFNoRecursion = Custom[NestedIFNoRecursion](x=code_block, y=code_block_2)
watch = Watch(nestedIFNoRecursion)
