# Dynamo graph TestNestedIfRecursion.dyn (Dynamo 0.7.1.17276)

code_block = CodeBlock { a=1; }
code_block_2 = CodeBlock { 1; }
eq = code_block == code_block_2
code_block_3 = CodeBlock { 1; }
code_block_4 = CodeBlock { 0; }
if_ = If(eq, code_block_3, code_block_4)
code_block_5 = CodeBlock { 10; }
add = if_ + code_block_5
code_block_6 = CodeBlock { 10; }
mul = if_ * code_block_6
if_2 = If(if_, add, mul)
