# Dynamo graph TestVariableIndexingInCBN.dyn (Dynamo 0.9.1.3293)

code_block = CodeBlock { {{{1,2,3}, {4, 5, 6}}, {{7, 8, 9}, {10, 11, 12}}, {{13, 14, 15}, {16, 17, 18}}}; 1; 0; 1; 2; }
code_block_2 = CodeBlock(a=code_block.out0, j=code_block.out1, b=code_block.out0, x=code_block.out2, y=code_block.out3, z=code_block.out4) { i = 0; k = 2; a[i][j][k]; b[x][y][z]; }
watch = Watch(code_block_2.out2)
watch_2 = Watch(code_block_2.out3)
