# Dynamo graph Test_IfINCustomNode_4058.dyn (Dynamo 0.7.1.17276)

integer_slider = IntegerSlider(3, range=0..100)
code_block = CodeBlock { 3; }
testIfNodeCN = Custom[testIfNodeCN](a=integer_slider, y=code_block)
watch = Watch(testIfNodeCN)
