# Dynamo graph Test_InportOutportConnections_RetainedForCodeBlockErrorsInFile.dyn (Dynamo 2.0.0.3463)

code_block = CodeBlock { 1; 2; 3; 4; 5; }
code_block_2 = CodeBlock(a=code_block.out0, b=code_block.out1, c=code_block.out2, d=code_block.out3, e=code_block.out4) { x = {a@,b,c,d,e}; x[1]; x[3]; }
code_block_3 = CodeBlock(arr=code_block_2.x, a=code_block_2.out1, b=code_block_2.out2) { arr; {a,b}; }
