# Dynamo graph Test_PortErrorBehavior_CodeBlockErrorsInFile.dyn "FuncCB_Error_PortInfo" (Dynamo 2.0.0.4176)

number = DoubleInput(10)
code_block = CodeBlock(val=number)
# ---------- code_block.designscript (7 lines) ----------
val;
def foo()
{
	return 0;
}
val*10;
{val};
# ----------------------------------------
watch = Watch(code_block.out1)
