# Dynamo graph apply_property.dyn (Dynamo 1.0.1.1743)

X = Point.X()
code_block = CodeBlock { 42; }
code_block_2 = CodeBlock { 23; }
byCoordinates = Point.ByCoordinates(x=code_block, y=code_block_2)
apply = Apply(X, byCoordinates)
