# Dynamo graph colorRangeBad.dyn (Dynamo 2.0.0.4425)

code_block = CodeBlock { 255; }
red = Color.ByARGB(r=code_block)
green = Color.ByARGB(g=code_block)
blue = Color.ByARGB(b=code_block)
blue_fade = DoubleSlider(0.23, range=0..1 step 0.01)
code_block_2 = CodeBlock(red=red, green=green, blue=blue, num=blue_fade) { [red,green,blue]; [0,num,1]; }
code_block_3 = CodeBlock { 0..100..#5; 10; }
byCoordinates = Point.ByCoordinates(x=code_block_3.out0, y=code_block_3.out0, z=code_block_3.out0, lacing=CrossProduct)
code_block_4 = CodeBlock(x=byCoordinates) { x[0][0][0]; }
distanceTo = Geometry.DistanceTo(geometry=code_block_4, other=byCoordinates)
code_block_5 = CodeBlock { 0; 1; }
remapRange = Math.RemapRange(numbers=distanceTo, newMin=code_block_5.out0, newMax=code_block_5.out1)
color_range = ColorRange(colors=code_block_2.out0, indices=code_block_2.out1, value=remapRange)
