# Dynamo graph conditionalCustomFunction_3483.dyn (Dynamo 0.7.1.17276)

double_slider = DoubleSlider(2.647, range=-5..5)
pass_nothing_below_1 = Custom[Pass Nothing Below 1](x=double_slider)  # Takes inputs and only passes 1 or values above 1
watch = Watch(pass_nothing_below_1)
