# Dynamo graph createCube_codeBlockNode.dyn (Dynamo 0.8.1.1681)

byCoordinates = Point.ByCoordinates()
code_block = CodeBlock { 5; }
code_block_2 = CodeBlock(ctrPt=byCoordinates, x=code_block)
# ---------- code_block_2.designscript (7 lines) ----------
pln = Plane.ByOriginNormal(ctrPt,Vector.ZAxis());
rect = Rectangle.ByWidthLength(pln,x,x);
p1 = Point.Origin();
p2 = Point.ByCoordinates(0,0,(ctrPt.X+x));
path = Line.ByStartPointEndPoint(p1,p2);
s = Solid.BySweep(rect,path);
s.Area;
# ----------------------------------------
