# Dynamo graph define_dictionary.dyn (Dynamo 1.2.1.2722)

code_block = CodeBlock { s["a"]=1; s["b"]=2; s["c"]=3; s; }
watch = Watch(code_block.s)
code_block_2 = CodeBlock { s["a"]="Bob"; s["b"]="Sally"; s["c"]="Pat"; s; }
watch_2 = Watch(code_block_2.s)
