# Dynamo graph define_dictionary2.dyn (Dynamo 1.2.1.2861)

code_block = CodeBlock { s["foo"] = "bar"; }  # unwired: s
watch_bar = Watch(code_block)
code_block_2 = CodeBlock { s["foo"] = 1024; }  # unwired: s
watch_1024 = Watch(code_block_2)
code_block_3 = CodeBlock { t["bar"] = 1024; t; }  # unwired: t
watch_1024_2 = Watch(code_block_3.t)
code_block_4 = CodeBlock { t["bar"] = "qux"; t; }  # unwired: t
watch_qux = Watch(code_block_4.out0)
watch_qux_2 = Watch(code_block_4.t)
watch_1024_3 = Watch(code_block_3.out0)
code_block_5 = CodeBlock { m; m["bar"] = "qux"; }  # unwired: m
watch_qux_3 = Watch(code_block_5.m)
code_block_6 = CodeBlock { m; m["bar"] = 1024; }  # unwired: m
watch_1024_4 = Watch(code_block_6.m)
watch_qux_4 = Watch(code_block_5.out1)
watch_1024_5 = Watch(code_block_6.out1)
