# Dynamo graph githubissue_3446.dyn (Dynamo 0.9.1.4062)

string = StringInput("""1
2
3
4
5
6""")
string_2 = StringInput("\n")
split = String.Split(string, string_2)
watch = Watch(split)
code_block = CodeBlock()
# ---------- code_block.designscript (2 lines) ----------
"
";
# ----------------------------------------
split_2 = String.Split(string, code_block)
watch_2 = Watch(split_2)
code_block_2 = CodeBlock()
# ---------- code_block_2.designscript (6 lines) ----------
"1
2
3
4
5
6";
# ----------------------------------------
split_3 = String.Split(code_block_2, string_2)
watch_3 = Watch(split_3)
split_4 = String.Split(code_block_2, code_block)
watch_4 = Watch(split_4)
