# Dynamo graph githubissue_6729.dyn (Dynamo 1.0.1.1670)

code_block = CodeBlock { List.FilterByBoolMask({1..3,3..5},{{true,true,false},{false,true,true}}); }
code_block_2 = CodeBlock(lst=code_block) { List.GetItemAtIndex(lst["in"], 1); }
watch = Watch(code_block_2)
