# Dynamo graph heterogenous-input.dyn (Dynamo 1.2.1.2640)

code_block = CodeBlock { null; }
code_block_2 = CodeBlock { "Dynamo"; }
byCoordinates = Point.ByCoordinates()
code_block_3 = CodeBlock { 5; 10; }
byCoordinates_2 = Point.ByCoordinates(x=code_block_3.out0, y=code_block_3.out0)
byStartPointEndPoint = Line.ByStartPointEndPoint(startPoint=byCoordinates, endPoint=byCoordinates_2)
byCoordinates_3 = Point.ByCoordinates(x=code_block_3.out1)
byThreePoints = Arc.ByThreePoints(firstPoint=byCoordinates, secondPoint=byCoordinates_2, thirdPoint=byCoordinates_3)
create = List.Create(code_block, code_block_2, byStartPointEndPoint, byThreePoints)
code_block_4 = CodeBlock { 0.5; }
pointAtParameter = Curve.PointAtParameter(curve=create, param=code_block_4)
X = Point.X(pointAtParameter)
round = Math.Round(X)
watch = Watch(round)
length = Curve.Length(create)
round_2 = Math.Round(length)
watch_2 = Watch(round_2)
