# Dynamo graph ifnode_3483.dyn (Dynamo 0.7.1.17276)

double_slider = DoubleSlider(5, range=-5..5)
number = DoubleInput(1)
lessThan = Compare.LessThan(double_slider, number)
if_ = If(lessThan, number, double_slider)
watch = Watch(if_)
