# Dynamo graph ifnode_3483_2.dyn (Dynamo 0.7.1.17276)

number = DoubleInput(-2..2)
number_2 = DoubleInput(1)
lessThan = Compare.LessThan(number, number_2)
if_ = If(lessThan, number_2, number)
watch = Watch(if_)
