# Dynamo graph longest_lacing.dyn (Dynamo 2.0.0.2967)

code_block = CodeBlock { {1..3, 4..6}; 1..3; 1; }
code_block_2 = CodeBlock(a=code_block.out0, b=code_block.out1, c=code_block.out2)
# ---------- code_block_2.designscript (5 lines) ----------
def foo(x, y, z)
{
	return x+y+z;
}
foo(a<1L>, b<1L>, c<1L>);
# ----------------------------------------
