# Dynamo custom node makeSpiralFromBasePtCenterPtHeight.dyf (Dynamo 1.0.1.1743)
# category: building

basePoint = Input()
centerPoint = Input()
distanceTo = DSFunction(basePoint, centerPoint)  # "Point.DistanceTo"
code_block = CodeBlock(radius=distanceTo) { radius; }
height = Input()
code_block_2 = CodeBlock(a=code_block, b=height) { rad=a..a/10..#10; hei=0..b..#10; }
code_block_3 = CodeBlock { ang=0..360..#10; }
code_block_4 = CodeBlock(r=code_block_2.rad, theta=code_block_3, c=code_block_2.hei) { x=r*Cos(theta); y=r*Sin(theta); z=c; }
byCoordinates = Point.ByCoordinates(x=code_block_4.x, y=code_block_4.y)
points = Output(byCoordinates)
