# Dynamo custom node referenceThis.dyf (Dynamo 1.0.1.1093)
# category: Test

referenceThis = FFITarget.ReferenceThis.ReferenceThis()
getItems = FFITarget.ReferenceThis.GetItems(referenceThis)
items = Output(getItems)
