# Dynamo graph regress618.dyn (Dynamo 0.6.3.26821)

code_block = CodeBlock { a = 0..10; b = a; b[2] = 100; }
code_block_2 = CodeBlock(b=code_block.b) { x = b; }
code_block_3 = CodeBlock { f = 0; }
add = code_block_2 + code_block_3
