# Dynamo graph regress7808.dyn (Dynamo 1.0.0.591)

code_block = CodeBlock()
# ---------- code_block.designscript (4 lines) ----------
def foo()
{
return = 21;
};
# ----------------------------------------
code_block_2 = CodeBlock { x = foo(); }
watch = Watch(code_block_2)
