# Dynamo graph regress9297.dyn (Dynamo 1.0.0.271)

# group: Thicken surface into a solid with a depth map
code_block = CodeBlock { surf; }
code_block_2 = CodeBlock()
# ---------- code_block_2.designscript (2 lines) ----------
// number of samples
2;
# ----------------------------------------
code_block_3 = CodeBlock(samples=code_block_2) { 0..1..#samples; }
pointAtParameter = Surface.PointAtParameter(surface=code_block, u=code_block_3, v=code_block_3, lacing=CrossProduct)
# note: File path for the depth map image
file_path = Filename("{path}")
fromPath = FileObject(file_path)  # "File.FromPath"
readFromFile = Image.ReadFromFile(fromPath)
pixels = Image.Pixels(image=readFromFile, xSamples=code_block_2, ySamples=code_block_2)
reverse = List.Reverse()
map = List.Map(list=pixels, f_x=reverse)

code_block_4 = CodeBlock(x=map) { Count(x[0]); }
watch = Watch(code_block_4)
