# Dynamo graph regress9450.dyn (Dynamo 1.0.0.621)

code_block = CodeBlock()
# ---------- code_block.designscript (4 lines) ----------
def mul(x, y = 3)
{
    return = x * y;
};
# ----------------------------------------
code_block_2 = CodeBlock { x = mul(2); }
watch = Watch(code_block_2)
