# Dynamo graph reorder.dyn (Dynamo 0.8.2.1594)

code_block = CodeBlock { null; }
code_block_2 = CodeBlock { {1,2,5,4}; }
reorder = Reorder(code_block, code_block_2, lacing=Longest)
code_block_3 = CodeBlock { 1..10; }
code_block_4 = CodeBlock { {1,2,5,4}; }
reorder_2 = Reorder(code_block_3, code_block_4, lacing=Longest)
