# Dynamo graph test.dyn (Dynamo 0.7.1.17276)

code_block = CodeBlock { a=1; }
code_block_2 = CodeBlock { 1; }
eq = code_block == code_block_2
code_block_3 = CodeBlock { b=1; }
code_block_4 = CodeBlock { 1; }
eq_2 = code_block_3 == code_block_4
add = code_block + code_block_3
code_block_5 = CodeBlock { null; }
eq_3 = add == code_block_5
if_ = If(eq_3, code_block_5, add)
addItemToEnd = List.AddItemToEnd(if_)
create = List.Create(code_block, code_block_3)
apply = Apply(addItemToEnd, create)
count = Count(apply)
lt = count < _
multipleIFRecursion = Custom[MultipleIFRecursion]()
code_block_6 = CodeBlock { c; }
if_2 = If(lt, multipleIFRecursion, code_block_6)
