# Dynamo custom node testIfNodeCN.dyf (Dynamo 0.7.1.17276)
# category: CustomNode

a = Input()
code_block = CodeBlock(a=a) { a; }
y = Input()
eq = code_block == y
code_block_2 = CodeBlock { 6; }
code_block_3 = CodeBlock { 3; }
if_ = If(eq, code_block_2, code_block_3)
result = Output(if_)
