# Dynamo custom node testMultipleIFCN.dyf (Dynamo 0.7.1.17276)
# category: CustomNode

a = Input()
code_block = CodeBlock { 5; }
lt = a < code_block
code_block_2 = CodeBlock { 1; }
code_block_3 = CodeBlock { 0; }
if_ = If(lt, code_block_2, code_block_3)
gt = a > code_block
code_block_4 = CodeBlock { 11; }
code_block_5 = CodeBlock { 10; }
if_2 = If(gt, code_block_4, code_block_5)
add = if_ + if_2
b = Output(add)
