# Dynamo graph test_hetereogenous_list.dyn (Dynamo 2.0.2.6826)

code_block = CodeBlock { [null,2,"dynamo",5]; }
code_block_2 = CodeBlock { [null,false,0,10.2]; }
code_block_3 = CodeBlock { [null,"2.1",4,15.2]; }
byCoordinates = Point.ByCoordinates(x=code_block, y=code_block_2, z=code_block_3, lacing=Shortest)
X = Point.X(point=byCoordinates)
Y = Point.Y(point=byCoordinates)
Z = Point.Z(point=byCoordinates)
