# Dynamo graph testfunction_forwardref_in_body.dyn (Dynamo 2.11.0.4075)

code_block = CodeBlock()
# ---------- code_block.designscript (5 lines) ----------
def caller(x)
{
return = callee(x);
};
caller(5);
# ----------------------------------------
code_block_2 = CodeBlock()
# ---------- code_block_2.designscript (4 lines) ----------
def callee(x)
{
return = x + 1;
};
# ----------------------------------------
