# Dynamo graph contains.dyn (Dynamo 1.1.1.1960)

code_block = CodeBlock { 1; 2; }
byCoordinates = Point.ByCoordinates(x=code_block.out0, y=code_block.out1)
code_block_2 = CodeBlock(pts=byCoordinates) { {pts}; }
byCoordinates_2 = Point.ByCoordinates(x=code_block.out0, y=code_block.out1)
contains = Contains(code_block_2, byCoordinates_2)
watch = Watch(contains)
code_block_3 = CodeBlock(pts=byCoordinates) { {pts}; }
contains_2 = Contains(code_block_3, byCoordinates)
watch_2 = Watch(contains_2)
