# Dynamo graph contains2.dyn (Dynamo 1.1.1.1921)

code_block = CodeBlock { {{1,2,3}, {4, 5, 6}}; {4, 5, 6}; }
contains = Contains(code_block.out0, code_block.out1)
watch = Watch(contains)
byCoordinates = Point.ByCoordinates()
code_block_2 = CodeBlock { 1; }
byCoordinates_2 = Point.ByCoordinates(x=code_block_2, y=code_block_2)
code_block_3 = CodeBlock(pt1=byCoordinates, pt2=byCoordinates_2) { {pt1, pt2}; }
code_block_4 = CodeBlock { 1; }
byCoordinates_3 = Point.ByCoordinates(x=code_block_4, y=code_block_4)
contains_2 = Contains(code_block_3, byCoordinates_3)
watch_2 = Watch(contains_2)
code_block_5 = CodeBlock(pt1=byCoordinates, pt2=byCoordinates_2) { {pt1, {pt2}}; }
code_block_6 = CodeBlock(pt2=byCoordinates_3) { {pt2}; }
contains_3 = Contains(code_block_5, code_block_6)
watch_3 = Watch(contains_3)
