# Dynamo graph modDoesntWork.dyn (Dynamo 0.7.6.4261)

code_block = CodeBlock()
# ---------- code_block.designscript (4 lines) ----------
{12.129,
8.026,
11.899,
7.83};
# ----------------------------------------
code_block_2 = CodeBlock { 2; }
code_block_3 = CodeBlock(x=code_block, y=code_block_2) { x % y; }
mod = code_block % code_block_2
equals = Equals(code_block_3, mod)
python_script = Python(IN[0]=code_block, IN[1]=code_block_2)
# ---------- python_script.python (13 lines) ----------
import clr
clr.AddReference('ProtoGeometry')
from Autodesk.DesignScript.Geometry import *
#The inputs to this node will be stored as a list in the IN variable.
numbers = IN[0]
num = IN[1]

results = []
for i in range(len(numbers)):
	results.append(numbers[i] % num)

#Assign your output to the OUT variable
OUT = results
# ----------------------------------------
equals_2 = Equals(mod, python_script)
equals_3 = Equals(code_block_3, python_script)
