# Dynamo graph DataFromFile_ascending.dyn (Dynamo 0.7.4.3075)

file_path = Filename("..\..\..\test\core\excel\ascending.xlsx")
fromPath = FileObject(file_path)  # "File.FromPath"
readExcelFile = Excel.ReadExcelFile(fromPath)
getWorksheetsFromExcelWorkbook = Excel.GetWorksheetsFromExcelWorkbook(readExcelFile)
firstItem = List.FirstItem(getWorksheetsFromExcelWorkbook)
getDataFromExcelWorksheet = Excel.GetDataFromExcelWorksheet(firstItem)
watch = Watch(getDataFromExcelWorksheet)
