# Dynamo graph Defect_MAGN_883.dyn (Dynamo 1.0.1.1743)

file_path = Filename("..\..\..\test\core\excel\Defect_MAGN_883.xlsx")
readExcelFile = Excel.ReadExcelFile(file_path)
string = StringInput("Z")
getExcelWorksheetByName = Excel.GetExcelWorksheetByName(readExcelFile, string)
getDataFromExcelWorksheet = Excel.GetDataFromExcelWorksheet(getExcelWorksheetByName)
watch = Watch(getDataFromExcelWorksheet)
