# Dynamo graph Defect_MAGN_883_OpenXml.dyn (Dynamo 2.12.0.4627)

file_path = Filename(".\Defect_MAGN_883.xlsx")
code_block = CodeBlock { "Z"; }
openXMLImportExcel = Data.OpenXMLImportExcel(filePath=file_path, sheetName=code_block)
