# Dynamo graph Excel_MAGN6872.dyn (Dynamo 0.8.1.1332)

newExcelWorkbook = Excel.NewExcelWorkbook()
getWorksheetsFromExcelWorkbook = Excel.GetWorksheetsFromExcelWorkbook(newExcelWorkbook)
firstItem = List.FirstItem(getWorksheetsFromExcelWorkbook)
number = DoubleInput(0)
code_block = CodeBlock { 1..3; }
code_block_2 = CodeBlock { 1..5; }
code_block_3 = CodeBlock { 1..7; }
code_block_4 = CodeBlock { 1..5; }
create = List.Create(code_block, code_block_2, code_block_3, code_block_4)
writeDataToExcelWorksheet = Excel.WriteDataToExcelWorksheet(firstItem, number, number, create)
getDataFromExcelWorksheet = Excel.GetDataFromExcelWorksheet(writeDataToExcelWorksheet)
watch = Watch(getDataFromExcelWorksheet)
