# Dynamo graph ExistingWorkbook_AddWorksheet.dyn (Dynamo 1.0.1.1743)

file_path = Filename("..\..\..\test\core\excel\mixedNumbersAndStrings.xlsx")
readExcelFile = Excel.ReadExcelFile(file_path)
string = StringInput("CoolNewWorksheet")
addExcelWorksheetToWorkbook = Excel.AddExcelWorksheetToWorkbook(readExcelFile, string)
getExcelWorksheetByName = Excel.GetExcelWorksheetByName(readExcelFile, string)
perform_all = Begin(expr1=addExcelWorksheetToWorkbook, expr2=getExcelWorksheetByName)
watch = Watch(perform_all)
