# Dynamo graph ExportToExcelAsString.dyn (Dynamo 2.11.0.3455)

file_path = Filename("..\Documents\GitHub\StudioLEDynamo\test\core\excel\WriteFile.xlsx")
code_block = CodeBlock { "Sheet1"; 0; true; }
data = CodeBlock { 12; }
exportToExcel = Data.ExportToExcel(filePath=file_path, sheetName=code_block.out0, startRow=code_block.out1, startCol=code_block.out1, data=data, overWrite=code_block.out2, writeAsString=code_block.out2)
