# Dynamo graph ExportToExcelAsString_OpenXml.dyn (Dynamo 2.12.0.4627)

string = StringInput("")
code_block = CodeBlock { "mySheet"; [1.23,true,DateTime.ByDateAndTime(2021,4,8,10,14,0,0),"Hello"]; true; }
openXMLExportExcel = Data.OpenXMLExportExcel(filePath=string, sheetName=code_block.out0, data=code_block.out1, writeAsString=code_block.out2)
code_block_2 = CodeBlock(a=openXMLExportExcel) { a; "mySheet"; }
openXMLImportExcel = Data.OpenXMLImportExcel(filePath=string, sheetName=code_block_2.out1)
type = Object.Type(object=openXMLImportExcel)
