# Dynamo graph Hammersmith.dyn

number = DoubleInput(0)
# note: Data From Excel
file_path = StringFilename("..\..\..\test\core\excel\Hammersmith_copyPaste.xlsx")
open_excel_workbook = ReadExcelFile(file_path)
string = StringInput("Sheet1")
get_excel_worksheet_by_name = GetExcelWorksheetByName(open_excel_workbook, string)
get_data_from_excel_worksheet = GetDataFromExcelWorksheet(get_excel_worksheet_by_name)
remove_from_list = RemoveFromList(number, get_data_from_excel_worksheet)
flatten_completely = FlattenList(remove_from_list)
number_2 = DoubleInput(3)
build_sublists = Sublists("2", flatten_completely, number_2, lacing=Longest)
flatten_completely_2 = FlattenList(build_sublists)
watch = Watch(remove_from_list)
number_3 = DoubleInput(0)
string_2 = StringInput(",")
split_string = SplitString(arg1=string_2)
file_path_2 = StringFilename("..\..\..\test\core\excel\Hammersmith_Copy.csv")
read_text_file = FileReader(file_path_2)
string_3 = StringInput("\n")
split_string_2 = SplitString(read_text_file, string_3)
map = Map(split_string, split_string_2)
remove_from_list_2 = RemoveFromList(number_3, map)
watch_2 = Watch(remove_from_list_2)
xyz_from_list_of_numbers = XyzFromListOfNumbers(flatten_completely)
number_4 = DoubleInput(4)
partition_list = Slice(xyz_from_list_of_numbers, number_4)
string_to_number = String2Num(lacing=Longest)
map_2 = Map(string_to_number, remove_from_list_2)
watch_3 = Watch(map_2)
watch_4 = Watch()
xyz_from_list_of_numbers_2 = XyzFromListOfNumbers()
formula = Formula("0.00328084*x", lacing=Longest)
map_3 = Map(formula, map_2)
map_4 = Map(xyz_from_list_of_numbers_2, map_3)
lines_through_xyz = CurvesThroughPoints(map_4, lacing=Longest)
watch_3d = Watch3D(lines_through_xyz)
watch_5 = Watch(read_text_file)
watch_6 = Watch(map)
watch_7 = Watch(map_4)
watch_8 = Watch(map_3)
