# Dynamo graph HammersmithCSVFile_Open.dyn (Dynamo 1.0.1.1743)

file_path = Filename("C:\Users\boyerp\Dropbox\Github\Autodesk\Dynamo\test\core\excel\Hammersmith_Copy.csv")
readText = File.ReadText(file_path)
string = StringInput("\n")
split = String.Split(readText, string)
string_2 = StringInput(",")
split_2 = String.Split(arg1=string_2)
map = List.Map(list=split, f_x=split_2)
number = DoubleInput(0)
removeItemAtIndex = List.RemoveItemAtIndex(list=map, indices=number)
toNumber = String.ToNumber(lacing=Longest)
map_2 = List.Map(list=removeItemAtIndex, f_x=toNumber)
