# Dynamo graph HammersmithOpenXmlFile_Open.dyn (Dynamo 2.12.0.4556)

file_path = Filename(".\Hammersmith_Copy.xlsx")
code_block = CodeBlock { "Hammersmith_Copy"; }
openXMLImportExcel = Data.OpenXMLImportExcel(filePath=file_path, sheetName=code_block)
