# Dynamo graph ImportExcelFileShowArray.dyn (Dynamo 2.5.3.7984)

file_path = Filename("C:\Repositories\GitHub\Dynamo\test\core\excel\SingleSheet.xlsx")
file_from_path = FileObject(path=file_path)
string = StringInput("Sheet1")
boolean = BoolSelector(true)
boolean_2 = BoolSelector(false)
importExcel = Data.ImportExcel(file=file_from_path, sheetName=string, readAsStrings=boolean, showExcel=boolean_2)
watch = Watch(importExcel)
