# Dynamo graph NewWorkbook_Add1DListData.dyn (Dynamo 1.0.1.1743)

newExcelWorkbook = Excel.NewExcelWorkbook()
getWorksheetsFromExcelWorkbook = Excel.GetWorksheetsFromExcelWorkbook(newExcelWorkbook)
firstItem = List.FirstItem(getWorksheetsFromExcelWorkbook)
number = DoubleInput(0)
number_2 = DoubleInput(0..100)
writeDataToExcelWorksheet = Excel.WriteDataToExcelWorksheet(firstItem, number, number, number_2)
getDataFromExcelWorksheet = Excel.GetDataFromExcelWorksheet(writeDataToExcelWorksheet)
watch = Watch(getDataFromExcelWorksheet)
