# Dynamo graph NewWorkbook_Add2DListData.dyn (Dynamo 0.6.3.21066)

new_excel_workbook = NewExcelWorkbook()
get_worksheets_from_excel = GetWorksheetsFromExcelWorkbook(new_excel_workbook)
first_of_list = First(get_worksheets_from_excel)
number = DoubleInput(0)
number_2 = DoubleInput(0..100)
number_3 = DoubleInput(5)
repeat = Repeat(number_2, number_3, lacing=Longest)
write_data_to_excel_worksheet = WriteDataToExcelWorksheet(first_of_list, number, number, repeat)
get_data_from_excel_worksheet = GetDataFromExcelWorksheet(write_data_to_excel_worksheet)
watch = Watch(get_data_from_excel_worksheet)
watch_2 = Watch(repeat)
