# Dynamo graph NewWorkbook_Add2DListData_OpenXml.dyn (Dynamo 2.12.0.4616)

string = StringInput("")
code_block = CodeBlock { 0..100; 5; "Sheet1"; }
ofRepeatedItem = List.OfRepeatedItem(item=code_block.out0, amount=code_block.out1)
openXMLExportExcel = Data.OpenXMLExportExcel(filePath=string, sheetName=code_block.out2, data=ofRepeatedItem)
code_block_2 = CodeBlock(a=openXMLExportExcel) { a; "Sheet1"; }
openXMLImportExcel = Data.OpenXMLImportExcel(filePath=string, sheetName=code_block_2.out1)
