# Dynamo graph NewWorkbook_AddMixed1DData.dyn (Dynamo 0.7.0.19361)

newExcelWorkbook = Excel.NewExcelWorkbook()
getWorksheetsFromExcelWorkbook = Excel.GetWorksheetsFromExcelWorkbook(newExcelWorkbook)
firstItem = List.FirstItem(getWorksheetsFromExcelWorkbook)
code_block = CodeBlock { 0; }
string = StringInput("doodle")
number = DoubleInput(0)
number_2 = DoubleInput(21029)
string_2 = StringInput("")
number_3 = DoubleInput(-90)
create_list = List.Create(string, number, number_2, string_2, number_3)
writeDataToExcelWorksheet = Excel.WriteDataToExcelWorksheet(firstItem, code_block, code_block, create_list)
getDataFromExcelWorksheet = Excel.GetDataFromExcelWorksheet(writeDataToExcelWorksheet)
watch = Watch(getDataFromExcelWorksheet)
