# Dynamo graph NewWorkbook_AddNullItemData.dyn (Dynamo 2.8.0.2266)

newExcelWorkbook = Excel.NewExcelWorkbook()
getWorksheetsFromExcelWorkbook = Excel.GetWorksheetsFromExcelWorkbook(workbook=newExcelWorkbook)
firstItem = List.FirstItem(list=getWorksheetsFromExcelWorkbook)
number = DoubleInput(0)  # graph input
code_block = CodeBlock { null; }
writeDataToExcelWorksheet = Excel.WriteDataToExcelWorksheet(worksheet=firstItem, startRow=number, startColumn=number, data=code_block)
getDataFromExcelWorksheet = Excel.GetDataFromExcelWorksheet(worksheet=writeDataToExcelWorksheet)
watch = Watch(getDataFromExcelWorksheet)
