# Dynamo graph NewWorkbook_AddWorksheet.dyn (Dynamo 0.7.0.27550)

newExcelWorkbook = Excel.NewExcelWorkbook()
string = StringInput("CoolWorksheet")
getExcelWorksheetByName = Excel.GetExcelWorksheetByName(newExcelWorkbook, string)
addExcelWorksheetToWorkbook = Excel.AddExcelWorksheetToWorkbook(newExcelWorkbook, string)
watch = Watch(addExcelWorksheetToWorkbook)
