# Dynamo graph NewWorkbook_AddWorksheet_OpenXml.dyn (Dynamo 2.12.0.4616)

string = StringInput("")
code_block = CodeBlock { "NotADefaultSheetName"; [1,2,3]; }
openXMLExportExcel = Data.OpenXMLExportExcel(filePath=string, sheetName=code_block.out0, data=code_block.out1)
code_block_2 = CodeBlock(a=openXMLExportExcel) { a; "NotADefaultSheetName"; }
openXMLImportExcel = Data.OpenXMLImportExcel(filePath=string, sheetName=code_block_2.out1)
