# Dynamo graph NewWorkbook_SaveAs.dyn (Dynamo 1.0.1.1743)

newExcelWorkbook = Excel.NewExcelWorkbook()
string = StringInput("")
saveAsExcelWorkbook = Excel.SaveAsExcelWorkbook(newExcelWorkbook, string)
