# Dynamo graph OverWriteExcelSheet_OpenXml.dyn (Dynamo 2.12.0.4626)

string = StringInput("")
code_block = CodeBlock { "Sheet1"; [[999,999,999],[999,999,999],[999,999,999]]; 1; true; }
openXMLExportExcel = Data.OpenXMLExportExcel(filePath=string, sheetName=code_block.out0, data=code_block.out1, startRow=code_block.out2, startColumn=code_block.out2, overWrite=code_block.out3)
code_block_2 = CodeBlock(a=openXMLExportExcel) { a; 1; }
openXMLImportExcel = Data.OpenXMLImportExcel(filePath=string, sheetName=code_block.out0, startRow=code_block_2.out1, startColumn=code_block_2.out1)
