# Dynamo graph OverWritePartialExcelSheet.dyn (Dynamo 0.8.1.1442)

file_path = Filename("..\..\..\test\core\excel\overwriteFilePartial.xlsx")
code_block = CodeBlock { "Sheet1"; }
code_block_2 = CodeBlock { 1; }
code_block_3 = CodeBlock { {{999, 999, 999}, {999, 999, 999}, {999, 999, 999}}; }
writeToFile = Excel.WriteToFile(filePath=file_path, sheetName=code_block, startRow=code_block_2, startCol=code_block_2, data=code_block_3)
