# Dynamo graph OverWritePartialExcelSheet_OpenXml.dyn (Dynamo 2.12.0.4626)

string = StringInput("")
code_block = CodeBlock { "Sheet1"; [[999,999,999],[999,999,999],[999,999,999]]; 1; }
openXMLExportExcel = Data.OpenXMLExportExcel(filePath=string, sheetName=code_block.out0, data=code_block.out1, startRow=code_block.out2, startColumn=code_block.out2)
code_block_2 = CodeBlock(a=openXMLExportExcel) { a; "Sheet1"; }
openXMLImportExcel = Data.OpenXMLImportExcel(filePath=string, sheetName=code_block_2.out1)
