# Dynamo graph ReadAndWriteExcel.dyn (Dynamo 0.7.4.3075)

file_path = Filename("..\..\..\test\core\excel\mixedNumbersAndStrings.xlsx")
fromPath = FileObject(file_path)  # "File.FromPath"
code_block = CodeBlock { "Sheet1"; }
readFromFile = Excel.ReadFromFile(fromPath, code_block)
watch = Watch(readFromFile)
string = StringInput("")
code_block_2 = CodeBlock { "mysheet2"; }
code_block_3 = CodeBlock { 1; }
writeToFile = Excel.WriteToFile(string, code_block_2, code_block_3, code_block_3, readFromFile)
