# Dynamo graph ReadAndWrite_OpenXml.dyn (Dynamo 2.12.0.4564)

string = StringInput("")
code_block = CodeBlock { "Sheet1"; "mysheet2"; 1; }
file_path = Filename(".\mixedNumbersAndStrings.xlsx")
openXMLImportExcel = Data.OpenXMLImportExcel(filePath=file_path, sheetName=code_block.out0)
openXMLExportExcel = Data.OpenXMLExportExcel(filePath=string, sheetName=code_block.out1, data=openXMLImportExcel, startRow=code_block.out2, startColumn=code_block.out2)
