# Dynamo graph ReadEmptyCellsAsStrings_OpenXml.dyn (Dynamo 2.12.0.4565)

file_path = Filename(".\readAsStrings.xlsx")
code_block = CodeBlock { "Sheet1"; true; }
openXMLImportExcel = Data.OpenXMLImportExcel(filePath=file_path, sheetName=code_block.out0, readAsString=code_block.out1)
