# Dynamo graph ReadExcelAsStrings.dyn (Dynamo 0.8.1.1441)

file_path = Filename("..\..\..\test\core\excel\mixedNumbersAndStrings.xlsx")
fromPath = FileObject(file_path)  # "File.FromPath"
code_block = CodeBlock { "Sheet1"; }
code_block_2 = CodeBlock { true; }
readFromFile = Excel.ReadFromFile(file=fromPath, sheetName=code_block, readAsStrings=code_block_2)
watch = Watch(readFromFile)
