# Dynamo graph ReadFile.dyn (Dynamo 0.8.1.1521)

watch = Watch()
file_path = Filename("..\..\..\test\core\excel\WriteFile.xlsx")
fromPath = FileObject(file_path)  # "File.FromPath"
code_block = CodeBlock { "Sheet1"; }
readFromFile = Excel.ReadFromFile(file=fromPath, sheetName=code_block)
