# Dynamo graph ReadFormula.dyn (Dynamo 0.8.1.1463)

file_path = Filename("..\..\..\test\core\excel\mixedNumbersAndStrings.xlsx")
fromPath = FileObject(file_path)  # "File.FromPath"
code_block = CodeBlock { "Sheet1"; }
readFromFile = Excel.ReadFromFile(file=fromPath, sheetName=code_block)
watch = Watch(readFromFile)
string = StringInput("")
code_block_2 = CodeBlock { "mysheet2"; }
code_block_3 = CodeBlock { 1; }
writeToFile = Excel.WriteToFile(filePath=string, sheetName=code_block_2, startRow=code_block_3, startCol=code_block_3, data=readFromFile)
