# Dynamo graph ReadNonExistingFile.dyn (Dynamo 0.8.1.1463)

file_path = Filename("..\..\..\\test\core\excel\NonExistingFile.xlsx")
fromPath = FileObject(file_path)  # "File.FromPath"
string = StringInput("Sheet1")
readFromFile = Excel.ReadFromFile(file=fromPath, sheetName=string)
watch = Watch(readFromFile)
