# Dynamo graph ReadNonExistingFile_OpenXml.dyn (Dynamo 2.12.0.4565)

file_path = Filename(".\NonExistingFile.xlsx")
code_block = CodeBlock { "Sheet1"; }
openXMLImportExcel = Data.OpenXMLImportExcel(filePath=file_path, sheetName=code_block)
