# Dynamo graph ReadOnlyFile.dyn (Dynamo 0.8.1.1345)

file_path = Filename("..\..\..\test\core\excel\ReadOnlyFile.xlsx")
fromPath = FileObject(file_path)  # "File.FromPath"
code_block = CodeBlock { "Sheet1"; }
readFromFile = Excel.ReadFromFile(fromPath, code_block)
watch = Watch(readFromFile)
