# Dynamo graph SingleColumnAscending_OpenXml.dyn (Dynamo 2.12.0.4557)

file_path = Filename(".\ascending.xlsx")
code_block = CodeBlock { "Sheet1"; }
openXMLImportExcel = Data.OpenXMLImportExcel(filePath=file_path, sheetName=code_block)
