# Dynamo graph WorksheetByName_InvalidInput.dyn (Dynamo 0.7.4.3075)

file_path = Filename("..\..\..\test\core\excel\mixedNumbersAndStrings.xlsx")
fromPath = FileObject(file_path)  # "File.FromPath"
readExcelFile = Excel.ReadExcelFile(fromPath)
string = StringInput("NotAWorksheet")
getExcelWorksheetByName = Excel.GetExcelWorksheetByName(readExcelFile, string)
watch = Watch(getExcelWorksheetByName)
