# Dynamo graph WorksheetsFromFile.dyn (Dynamo 0.7.4.3075)

file_path = Filename("..\..\..\test\core\excel\mixedNumbersAndStrings.xlsx")
fromPath = FileObject(file_path)  # "File.FromPath"
readExcelFile = Excel.ReadExcelFile(fromPath)
getWorksheetsFromExcelWorkbook = Excel.GetWorksheetsFromExcelWorkbook(readExcelFile)
watch = Watch(getWorksheetsFromExcelWorkbook)
