# Dynamo graph WriteEmptyArrayToExcel.DYN (Dynamo 0.8.1.1193)

string = StringInput("")
code_block = CodeBlock { "asdas"; }
code_block_2 = CodeBlock { 1; }
empty = List.Empty()
code_block_3 = CodeBlock(x=empty) { {"2", x, "3"}; }
watch = Watch(code_block_3)
writeToFile = Excel.WriteToFile(string, code_block, code_block_2, code_block_2, watch)
