# Dynamo graph WriteEmptyListToExcel.DYN (Dynamo 0.8.1.1403)

string = StringInput("")
code_block = CodeBlock { "test"; }
code_block_2 = CodeBlock { 0; }
code_block_3 = CodeBlock { {}; }
writeToFile = Excel.WriteToFile(string, code_block, code_block_2, code_block_2, code_block_3)
