# Dynamo graph WriteFile.dyn (Dynamo 0.8.1.1521)

file_path = Filename("C:\Dynamo\Dynamo\test\core\excel\WriteFile.xlsx")
code_block = CodeBlock { "Sheet1"; }
code_block_2 = CodeBlock { 0; }
code_block_3 = CodeBlock { 5..10; }
code_block_4 = CodeBlock { true; }
writeToFile = Excel.WriteToFile(filePath=file_path, sheetName=code_block, startRow=code_block_2, startCol=code_block_2, data=code_block_3, overWrite=code_block_4)
watch = Watch(writeToFile)
