# Dynamo graph WriteFunctionObject_OpenXml.dyn (Dynamo 2.12.0.4626)

string = StringInput("")
code_block = CodeBlock { "mySheet"; }
transpose = List.Transpose()  # unwired: lists
openXMLExportExcel = Data.OpenXMLExportExcel(filePath=string, sheetName=code_block, data=transpose)
code_block_2 = CodeBlock(a=openXMLExportExcel) { a; "mySheet"; }
openXMLImportExcel = Data.OpenXMLImportExcel(filePath=string, sheetName=code_block_2.out1)
