# Dynamo graph WriteFunctionobject.dyn (Dynamo 0.8.1.1303)

string = StringInput("")
code_block = CodeBlock { "helix"; }
number = DoubleInput(0)
transpose = List.Transpose()
writeToFile = Excel.WriteToFile(string, code_block, number, number, transpose)
