# Dynamo graph WriteJaggedArrayToExcel.dyn (Dynamo 0.8.1.1192)

string = StringInput("")
code_block = CodeBlock { "mySheet"; }
code_block_2 = CodeBlock { 1; }
code_block_3 = CodeBlock { {{1,2,3,null}, {1,2,3,4}, {null,2,3}}; }
transpose = List.Transpose(code_block_3)
writeToFile = Excel.WriteToFile(string, code_block, code_block_2, code_block_2, transpose)
