# Dynamo graph WriteMixed1DData_OpenXml.dyn (Dynamo 2.12.0.4566)

string = StringInput("")
code_block = CodeBlock { "Sheet1"; ["text",true,DateTime.ByDateAndTime(2021,4,1,14,51,30,0),1,1.23]; }
openXMLExportExcel = Data.OpenXMLExportExcel(filePath=string, sheetName=code_block.out0, data=code_block.out1)
code_block_2 = CodeBlock(a=openXMLExportExcel) { a; "Sheet1"; }
openXMLImportExcel = Data.OpenXMLImportExcel(filePath=string, sheetName=code_block_2.out1)
