# Dynamo graph WriteModifyGraph_2.dyn (Dynamo 0.8.1.1483)

file_path = Filename("..\..\..\test\core\excel\WriteModifyGraph_2.xlsx")
code_block = CodeBlock { "Sheet1"; }
code_block_2 = CodeBlock { 0; }
code_block_3 = CodeBlock { 5..10; }
code_block_4 = CodeBlock { true; }
writeToFile = Excel.WriteToFile(filePath=file_path, sheetName=code_block, startRow=code_block_2, startCol=code_block_2, data=code_block_3, overWrite=code_block_4)
watch = Watch(writeToFile)
fromPath = FileObject(file_path)  # "File.FromPath"
readFromFile = Excel.ReadFromFile(file=fromPath, sheetName=code_block)
code_block_5 = CodeBlock { 2..5; }
