# Dynamo graph WriteModifyPath.dyn (Dynamo 0.8.1.1345)

file_path = Filename("..\..\..\test\core\excel\File1.xlsx")
code_block = CodeBlock { "Sheet1"; }
code_block_2 = CodeBlock { 0; }
code_block_3 = CodeBlock { 5..10; }
writeToFile = Excel.WriteToFile(file_path, code_block, code_block_2, code_block_2, code_block_3)
watch = Watch(writeToFile)
code_block_4 = CodeBlock { "..\..\..\\test\core\excel\File2.xlsx"; }
