# Dynamo graph WriteNestedEmptyListToExcel.DYN (Dynamo 0.8.1.1403)

file_path = Filename("..\..\..\test\core\excel\emptyCellInMiddle.xlsx")
code_block = CodeBlock { "test"; }
code_block_2 = CodeBlock { 2; 1; }
code_block_3 = CodeBlock { {{}, {}, {}}; }
writeToFile = Excel.WriteToFile(file_path, code_block, code_block_2.out0, code_block_2.out1, code_block_3)
