# Dynamo graph WriteNodeAndUpdateData.dyn (Dynamo 0.7.4.3075)

string = StringInput("")
code_block = CodeBlock { "mySheet"; }
code_block_2 = CodeBlock { 1; }
string_2 = StringInput("BBB")
writeToFile = Excel.WriteToFile(string, code_block, code_block_2, code_block_2, string_2)
