# Dynamo graph WriteNodeAndUpdateData_OpenXml.dyn (Dynamo 2.12.0.4625)

string = StringInput("output.xlsx")
code_block = CodeBlock { "mySheet"; 1; }
value = StringInput("BBB")
openXMLExportExcel = Data.OpenXMLExportExcel(filePath=string, sheetName=code_block.out0, data=value, startRow=code_block.out1, startColumn=code_block.out1)
code_block_2 = CodeBlock(a=openXMLExportExcel, b=value)
# ---------- code_block_2.designscript (5 lines) ----------
a;
b;
1;
// Note: Dependency on b is artificial to trigger re-read
sheetName = "mySheet" + String.Substring(b, 3, 0);
# ----------------------------------------
openXMLImportExcel = Data.OpenXMLImportExcel(filePath=string, sheetName=code_block_2.sheetName, startRow=code_block_2.out2, startColumn=code_block_2.out2)
