# Dynamo graph WriteNodewithError.dyn (Dynamo 0.8.1.1521)

file_path = Filename("..\..\..\test\core\excel\WriteNodeWithError.xlsx")
code_block = CodeBlock { "Sheet1"; }
code_block_2 = CodeBlock { 0; }
code_block_3 = CodeBlock { true; }
code_block_4 = CodeBlock(a=code_block_3) { Autodesk.Point.ByCoordinates(1,a,1); }
code_block_5 = CodeBlock { true; }
writeToFile = Excel.WriteToFile(filePath=file_path, sheetName=code_block, startRow=code_block_2, startCol=code_block_2, data=code_block_4, overWrite=code_block_5)
