# Dynamo graph WriteNonExistingSheet.dyn (Dynamo 0.8.1.1345)

file_path = Filename("..\..\..\test\core\excel\NonExistingsheet.xlsx")
code_block = CodeBlock { "newSheet"; }
code_block_2 = CodeBlock { 0; }
code_block_3 = CodeBlock { 1..5; }
writeToFile = Excel.WriteToFile(file_path, code_block, code_block_2, code_block_2, code_block_3)
