# Dynamo graph WriteNullValuesToExcel.DYN (Dynamo 0.8.1.1193)

string = StringInput("")
code_block = CodeBlock { "asdfas"; 0; }
code_block_2 = CodeBlock { null; }
writeToFile = Excel.WriteToFile(string, code_block.out0, code_block.out1, code_block.out1, code_block_2)
