# Dynamo graph WriteNullValuesToExcel1.DYN (Dynamo 0.8.1.1193)

string = StringInput("")
code_block = CodeBlock { "asdas"; }
code_block_2 = CodeBlock { 1; }
code_block_3 = CodeBlock { {"2", null, "3"}; }
watch = Watch(code_block_3)
writeToFile = Excel.WriteToFile(string, code_block, code_block_2, code_block_2, watch)
