# Dynamo graph WriteNullValuesToExcel_OpenXml.DYN "WriteNullValuesToExcel_OpenXml.DYN" (Dynamo 2.12.0.4626)

string = StringInput("")
code_block = CodeBlock { "mySheet"; null; }
openXMLExportExcel = Data.OpenXMLExportExcel(filePath=string, sheetName=code_block.out0, data=code_block.out1)
code_block_2 = CodeBlock(a=openXMLExportExcel) { a; "mySheet"; }
openXMLImportExcel = Data.OpenXMLImportExcel(filePath=string, sheetName=code_block_2.out1)
