# Dynamo graph WriteToReadOnlyFile.dyn (Dynamo 0.8.1.1521)

file_path = Filename("..\..\..\test\core\excel\WriteToReadOnlyFile.xlsx")
code_block = CodeBlock { "Sheet1"; }
code_block_2 = CodeBlock { 0; }
code_block_3 = CodeBlock { 5..10; }
writeToFile = Excel.WriteToFile(filePath=file_path, sheetName=code_block, startRow=code_block_2, startCol=code_block_2, data=code_block_3)
watch = Watch(writeToFile)
