# Dynamo graph dyn-5703.dyn (Dynamo 2.17.0.3205)

file_path = Filename(".\dyn-5703.xlsx")
file_from_path = FileObject(path=file_path)
code_block = CodeBlock { "Sheet1"; }
importExcel = Data.ImportExcel(file=file_from_path, sheetName=code_block)
code_block_2 = CodeBlock { 5; }
code_block_3 = CodeBlock { "done"; }
exportToExcel = Data.ExportToExcel(filePath=file_path, sheetName=code_block, startRow=code_block_2, startColumn=code_block_2, data=code_block_3)
watch = Watch(exportToExcel)
