# Dynamo graph formula_OpenXml.dyn (Dynamo 2.12.0.4627)

file_path = Filename(".\formula.xlsx")
code_block = CodeBlock { "Sheet1"; }
openXMLImportExcel = Data.OpenXMLImportExcel(filePath=file_path, sheetName=code_block)
