# Dynamo graph scientificNotation_OpenXml.dyn (Dynamo 2.18.0.2986)

file_path = Filename(".\ScientificNotation.xlsx")
code_block = CodeBlock { "Sheet1"; }
openXMLImportExcel = Data.OpenXMLImportExcel(filePath=file_path, sheetName=code_block)
