# Dynamo graph tests.dyn

file_path = StringFilename("C:\Users\boyerp\Dropbox\Github\Autodesk\Dynamo\test\good_dyns\excel\test.xlsx")
open_excel_workbook = ReadExcelFile(file_path)
string = StringInput("Sheet1")
get_excel_worksheet_by_name = GetExcelWorksheetByName(open_excel_workbook, string)
get_data_from_excel_worksheet = GetDataFromExcelWorksheet(get_excel_worksheet_by_name)
number = DoubleInput(4)
number_2 = DoubleInput(4)
string_2 = StringInput("Pedro")
write_data_to_excel_worksheet = WriteDataToExcelWorksheet(get_excel_worksheet_by_name, number, number_2, string_2)
add_excel_worksheet_to_workbook = AddExcelWorksheetToWorkbook(open_excel_workbook, string_2)
save_excel_workbook_as = SaveAsExcelWorkbook(open_excel_workbook, file_path)
perform_all = Begin(expr1=write_data_to_excel_worksheet, expr2=add_excel_worksheet_to_workbook, expr3=save_excel_workbook_as)
