# Dynamo graph ImageFileWriter.dyn (Dynamo 0.7.0.28265)

string = StringInput(".\")
string_2 = StringInput("test")
string_3 = StringInput("..\..\..\test\core\files\ImageFile.png")
loadImageFromPath = File.LoadImageFromPath(string_3)
writeImage = File.WriteImage(string, string_2, loadImageFromPath)
watch = Watch(writeImage)
