# Dynamo graph MigrationHintGetClosestPoint.dyn (Dynamo 0.7.2.34468)

number = DoubleInput(10)
number_2 = DoubleInput(0)
byCoordinates = Point.ByCoordinates(number, number, number_2)
byCoordinates_2 = Point.ByCoordinates(number_2, number_2, number)
byStartPointEndPoint = Line.ByStartPointEndPoint(byCoordinates, byCoordinates_2)
code_block = CodeBlock { 1; 2; 3; }
byCoordinates_3 = Point.ByCoordinates(code_block.out0, code_block.out1, code_block.out2)
getClosestPoint = Geometry.GetClosestPoint(byStartPointEndPoint, byCoordinates_3)
distanceTo = Geometry.DistanceTo(getClosestPoint, byCoordinates_3)
