# Dynamo graph TestExportToCSVFile.dyn (Dynamo 0.7.0.25176)

file_path = Filename("No file selected.")
code_block = CodeBlock { {{1,2,3,4,5},{-2,2.6,9},{0}}; }
exportToCSV = File.FileReader.ExportToCSV(file_path, code_block)
