# Dynamo graph TestExportToCSVFile_Negative.dyn (Dynamo 0.7.0.26074)

string = StringInput("an\\invalid/path//")
code_block = CodeBlock { {{1}}; }
exportToCSV = File.FileReader.ExportToCSV(string, code_block)
