# Dynamo graph fileTests_pre6_0.dyn (Dynamo 1.0.1.1743)

number = DoubleInput(0)
number_slider = DoubleSlider(41.28440367, range=0..100 step 0.1)
add = number + number_slider
number_2 = DoubleInput(0)
add_2 = add + number_2
watch = Watch(add)
