# Dynamo custom node GetTwoPoints_OnCurve.dyf (Dynamo 0.8.0.35318)
# category: GetPointsFromCurve
# It will return every two points on the curve.

curve = Input()
noOfPOints = Input()
code_block = CodeBlock(x=noOfPOints) { 0..1..#x; }
pointAtParameter = Curve.PointAtParameter(curve=curve, param=code_block, lacing=CrossProduct)
code_block_2 = CodeBlock(x=noOfPOints) { 0..(x-1)..2; }
getItemAtIndex = List.GetItemAtIndex(list=pointAtParameter, index=code_block_2)
code_block_3 = CodeBlock(x=noOfPOints) { 1..(x-1)..2; }
getItemAtIndex_2 = List.GetItemAtIndex(list=pointAtParameter, index=code_block_3)
create_list = List.Create(getItemAtIndex, getItemAtIndex_2)
transpose = Transpose(create_list)
points = Output(transpose)
