# Dynamo graph MAGN-1380.dyn (Dynamo 0.8.0.23211)

code_block = CodeBlock { Point.ByCoordinates(0, 0, 0); }
ZAxis = Vector.ZAxis()
byOriginNormal = Plane.ByOriginNormal(origin=code_block, normal=ZAxis)
integer_slider = IntegerSlider(80, range=30..80)
integer_slider_2 = IntegerSlider(30, range=0..30)
code_block_2 = CodeBlock(ht=integer_slider, floorNo=integer_slider_2) { 0..ht*(floorNo-1)/floorNo..#floorNo; }
offset = Plane.Offset(byOriginNormal, code_block_2)
integer_slider_3 = IntegerSlider(30, range=10..30)
integer_slider_4 = IntegerSlider(29, range=10..30)
integer_slider_5 = IntegerSlider(40, range=0..40)
code_block_3 = CodeBlock(buildRad=integer_slider_3, buildCrv1=integer_slider_4, buildCrv2=integer_slider_5, buildHt=integer_slider)
# ---------- code_block_3.designscript (6 lines) ----------
p1=Point.ByCoordinates(buildRad, 0, -1);
p2=Point.ByCoordinates(buildCrv1, 0, buildCrv2); 
p3=Point.ByCoordinates(buildCrv1, 0,2*buildCrv2); 
p4=Point.ByCoordinates(0, 0, buildHt);

{p1, p2, p4};
# ----------------------------------------
byPoints = NurbsCurve.ByPoints(code_block_3.out4)
code_block_4 = CodeBlock { 0; 360; }
byRevolve = Surface.ByRevolve(byPoints, code_block_3.p4, ZAxis, code_block_4.out0, code_block_4.out1)
intersect = Geometry.Intersect(geometry=offset, other=byRevolve)
endPoint = Curve.EndPoint(intersect)
flatten = Flatten(endPoint)
code_block_5 = CodeBlock(ptNumber=integer_slider_2) { 0..180*(ptNumber-1)/ptNumber..#ptNumber; }
rotate = Geometry.Rotate(geometry=flatten, origin=code_block_3.p4, axis=ZAxis, degrees=code_block_5)
byControlPoints = NurbsCurve.ByControlPoints(rotate)
code_block_6 = CodeBlock { 32; }
code_block_7 = CodeBlock(ribNo=code_block_6) { 0..360*(ribNo-1)/ribNo..#ribNo; }
rotate_2 = Geometry.Rotate(geometry=byControlPoints, origin=code_block_3.p4, axis=ZAxis, degrees=code_block_7)
code_block_8 = CodeBlock { 0..1..#10; }
pointAtParameter = Curve.PointAtParameter(curve=rotate_2, param=code_block_8, lacing=CrossProduct)
code_block_9 = CodeBlock(pointAtParameter)
# ---------- code_block_9.designscript (6 lines) ----------
def takeCurve(x: var[][], i : int)
{
return = {x[2*i], x[2*i+1]};
}

takeCurve(x, 0..15);
# ----------------------------------------
code_block_10 = CodeBlock(code_block_9)
# ---------- code_block_10.designscript (6 lines) ----------
def takeEveryTwo(x: var[][], i : int)
{
return = { x[0][2*i], x[0][2*i+1], x[1][2*i], x[1][2*i+1]};
}

takeEveryTwo((x)<1>,(0..31)<2>);
# ----------------------------------------
count = Count(code_block_9)
