# Dynamo graph readImageFileTest.dyn (Dynamo 0.7.4.3075)

file_path = Filename("\n      ")
fromPath = FileObject(file_path)  # "File.FromPath"
readFromFile = Image.ReadFromFile(fromPath)
number = DoubleInput(5)
pixels = Image.Pixels(readFromFile, number, number)
flatten = Flatten(pixels)
count = List.Count(flatten)
watch = Watch(count)
