# Dynamo custom node IsOdd.dyf "IsOdd?" (Dynamo 1.0.1.1743)
# category: Misc

n = Input()
number = DoubleInput(2)
mod = n % number
number_2 = DoubleInput(1)
eq = mod == number_2
odd = Output(eq)  # "odd?"
