# Dynamo graph filter-example.dyn (Dynamo 0.6.2.29585)

isodd = Custom[IsOdd?]()
number = DoubleInput(1)
number_2 = DoubleInput(5)
number_sequence = NumberRange(number, number_2, number)
filter = Filter(isodd, number_sequence)
watch = Watch(filter)
