# Dynamo graph formula-if.dyn (Dynamo 0.7.0.19549)

boolean = BoolSelector(false)
code_block = CodeBlock { 1; 2; }
formula = Formula("if(test, t, f)", test=boolean, t=code_block.out0, f=code_block.out1)
