# Dynamo graph formula-nestedParams-test.dyn (Dynamo 1.0.1.1743)

number = DoubleInput(5)
number_2 = DoubleInput(0.3)
formula = Formula("Sin(x) + Cos(x*a)", x=number, a=number_2)
watch = Watch(formula)
