# Dynamo graph formula-test.dyn

formula = Formula(lacing=Longest)
watch = Watch(formula)
number = DoubleInput(3)
number_2 = DoubleInput(2)
formula_2 = Formula(number, number_2, lacing=Longest)
watch_2 = Watch(formula_2)
divide = Division(lacing=Longest)
formula_3 = Formula(number, divide, number_2, lacing=Longest)
watch_3 = Watch(formula_3)
