# Dynamo graph formula4.dyn (Dynamo 2.19.0.5530)

formula = Formula("if(sin(90+0)>log10(100),45,tan(90))")
formula_2 = Formula("exp(10)")
formula_3 = Formula("if(if(x,y,z),y,z)")  # unwired: x, y, z
formula_4 = Formula("400")
code_block = CodeBlock { 1; 2; 3; }
formula_5 = Formula("x+y+z", x=code_block.out0, y=code_block.out1, z=code_block.out2)
