# Dynamo graph formula_lacing.dyn (Dynamo 0.7.0.26148)

code_block = CodeBlock { 1..2; }
code_block_2 = CodeBlock { 3..5; }
formula = Formula("a+b", a=code_block, b=code_block_2, lacing=Longest)
formula_2 = Formula("a+b", a=code_block, b=code_block_2, lacing=CrossProduct)
