# Dynamo graph export_units_one_cuboid.dyn (Dynamo 0.8.1.991)

code_block = CodeBlock { 1; 2; 3; }
byLengths = Cuboid.ByLengths(width=code_block.out0, length=code_block.out1, height=code_block.out2)
code_block_2 = CodeBlock { "exported.sat"; }
exportToSAT = ExportWithUnits(byLengths, code_block_2, exportedUnit=Millimeters)
