# Dynamo graph call_static_function.dyn (Dynamo 1.2.1.2780)

code_block = CodeBlock()
# ---------- code_block.designscript (12 lines) ----------
def getPoint(cs: Curve[])
{
   return = [Imperative]
   {
       pt = {};
       for (i in 0..(List.Count(cs)-1))
       {
           pt[i] = Curve.PointAtParameter(cs[i], 0.5);
       }
       return = pt;
    }
};
# ----------------------------------------
code_block_2 = CodeBlock()
# ---------- code_block_2.designscript (7 lines) ----------
p1 = Point.ByCoordinates();
p2 = Point.ByCoordinates(5, 0);
line = Line.ByStartPointEndPoint(p1, p2);

p3 = Point.ByCoordinates(2,2);
p4 = Point.ByCoordinates(8, 10);
line2 = Line.ByStartPointEndPoint(p3, p4);
# ----------------------------------------
create = List.Create(code_block_2.line, code_block_2.line2)
code_block_3 = CodeBlock(c=create) { getPoint(c); }
X = Point.X(code_block_3)
code_block_4 = CodeBlock(ys=X) { xs:int[] = ys; }
watch = Watch(code_block_4)
