# Dynamo graph delete_imperative_cbn_crash.dyn "crash_repro" (Dynamo 2.7.0.8475)

code_block = CodeBlock()
# ---------- code_block.designscript (22 lines) ----------
def giveMeEPlusPi()
{
  impPi = [Imperative]
  {
    return giveMePi();
  }
  impE = [Imperative]
  {
    return giveMeE();
  }
  return Math.Sum([impPi, impE]);
}

def giveMeE()
{
  return 2.718;
}

def giveMePi()
{
  return 3.142;
};
# ----------------------------------------
code_block_2 = CodeBlock { a=giveMeEPlusPi(); }
code_block_3 = CodeBlock(a=code_block_2) { b=a+1; }
code_block_4 = CodeBlock()
# ---------- code_block_4.designscript (30 lines) ----------
def grpCrvs(Curve:var[]..[])
    {
    	dis1 = (Curve.StartPoint)<1>.DistanceTo(Curve<2>)==0
        ||(Curve.EndPoint)<1>.DistanceTo(Curve<2>)==0;
    	ind1 = DSCore.List.AllIndicesOf(dis1<1>,true);
    	bln1 = true;
    	ind2 = [Imperative]
    	{
    		while (bln1)
    		{
    			cnt1 = DSCore.List.Count(ind1);
    			ind1 = grpIndx(ind1);
    			cnt2 = DSCore.List.Count(ind1);
    			bln1 = cnt2!=cnt1;
    		}
    		return = ind1;
    	}
    	crv1 = DSCore.List.GetItemAtIndex(Curve,ind2);
    	return = crv1;
    };

    def grpIndx(ind:var[]..[])
    {
    	ind1 = DSCore.List.SetIntersection(ind<1>,ind<2>);
    	cnt1 = DSCore.List.Count(ind1<1><2>)>1;
    	ind2 = DSCore.List.FilterByBoolMask(ind,cnt1<1>)["in"];
    	ind3 = DSCore.List.UniqueItems(DSCore.List.Flatten(ind2<1>,-1)<1>);
    	ind4 = DSCore.List.UniqueItems(DSCore.List.Sort(ind3<1>));
    	return = ind4;
    };
# ----------------------------------------
