# Dynamo graph inheritanceA.dyn (Dynamo 2.0.0.2821)

notDerivedFromInterfaceA = FFITarget.NotDerivedFromInterfaceA.NotDerivedFromInterfaceA()
foo = FFITarget.NotDerivedFromInterfaceA.Foo(notDerivedFromInterfaceA=notDerivedFromInterfaceA)
foo_2 = FFITarget.InterfaceA.Foo(interfaceA=notDerivedFromInterfaceA)
