# Dynamo graph inheritanceB.dyn (Dynamo 2.0.0.2821)

derivedFromInterfaceA = FFITarget.DerivedFromInterfaceA.DerivedFromInterfaceA()
foo = FFITarget.DerivedFromInterfaceA.Foo(derivedFromInterfaceA=derivedFromInterfaceA)
foo_2 = FFITarget.InterfaceA.Foo(interfaceA=derivedFromInterfaceA)
