# Dynamo graph inheritanceC.dyn (Dynamo 2.0.0.2821)

derivedFromInterfaceA = FFITarget.DerivedFromInterfaceA.DerivedFromInterfaceA()
code_block = CodeBlock(a=derivedFromInterfaceA) { [a]; }
foo = FFITarget.InterfaceA.Foo(interfaceA=code_block)
