# Dynamo graph inheritanceD.dyn (Dynamo 2.0.0.2821)

hidesMethodFromClassA = FFITarget.HidesMethodFromClassA.HidesMethodFromClassA()
bar = FFITarget.ClassA.Bar(classA=hidesMethodFromClassA)
bar_2 = FFITarget.HidesMethodFromClassA.Bar(hidesMethodFromClassA=hidesMethodFromClassA)
