# Dynamo graph inheritanceE.dyn (Dynamo 2.0.0.2821)

classA = FFITarget.ClassA.ClassA()
bar = FFITarget.HidesMethodFromClassA.Bar(hidesMethodFromClassA=classA)
bar_2 = FFITarget.ClassA.Bar(classA=classA)
