# Dynamo graph inheritanceF.dyn (Dynamo 2.0.0.4321)

classA = FFITarget.ClassA.ClassA()
code_block = CodeBlock(x=classA) { HidesMethodFromClassA.Foo(x); }
hidesMethodFromClassA = FFITarget.HidesMethodFromClassA.HidesMethodFromClassA()
code_block_2 = CodeBlock(x=hidesMethodFromClassA) { HidesMethodFromClassA.Foo(x); }
bar = FFITarget.ClassA.Bar(classA=hidesMethodFromClassA)
foo = FFITarget.ClassA.Foo(classA=hidesMethodFromClassA)
bar_2 = FFITarget.HidesMethodFromClassA.Bar(hidesMethodFromClassA=hidesMethodFromClassA)
foo_2 = FFITarget.ClassA.Foo(classA=classA)
bar_3 = FFITarget.ClassA.Bar(classA=classA)
bar_4 = FFITarget.HidesMethodFromClassA.Bar(hidesMethodFromClassA=classA)
