# Dynamo graph InspectorTest1.dyn (Dynamo 0.7.0.41071)

number = DoubleInput(255)
number_2 = DoubleInput(100)
byARGB = Color.ByARGB(arg1=number, arg2=number, arg3=number_2)
inspector = Inspector(byARGB, indices="1,2,3", numdropdowns=3)
