# Dynamo graph Abstract_CoordinateSystem_JSONParsing.dyn (Dynamo 3.0.0.5795)

code_block = CodeBlock { 2; 3; 4; }
byOrigin = CoordinateSystem.ByOrigin(x=code_block.out0, y=code_block.out1, z=code_block.out2)
byCoordinates = Point.ByCoordinates()
byCoordinates_2 = Vector.ByCoordinates(x=code_block.out0, y=code_block.out2)
number = DoubleInput(24)
rotate = CoordinateSystem.Rotate(coordinateSystem=byOrigin, origin=byCoordinates, axis=byCoordinates_2, degrees=number)
stringifyJSON = Data.StringifyJSON(values=rotate)
parseJSON = Data.ParseJSON(json=stringifyJSON)
isEqualTo = CoordinateSystem.IsEqualTo(coordinateSystem=rotate, other=parseJSON)
type = Object.Type(object=rotate)
type_2 = Object.Type(object=parseJSON)
eq = type == type_2
list_create = List.Create(item0=isEqualTo, item1=eq)
number_2 = DoubleInput(2.3)
scale = CoordinateSystem.Scale(coordinateSystem=rotate, amount=number_2)
stringifyJSON_2 = Data.StringifyJSON(values=scale)
parseJSON_2 = Data.ParseJSON(json=stringifyJSON_2)

# group: Coordinate Properties
watch = Watch(scale)
XAxis = CoordinateSystem.XAxis(coordinateSystem=watch)
YAxis = CoordinateSystem.YAxis(coordinateSystem=watch)
ZAxis = CoordinateSystem.ZAxis(coordinateSystem=watch)
list_create_2 = List.Create(item0=XAxis, item1=YAxis, item2=ZAxis)
watch_2 = Watch(parseJSON_2)
XAxis_2 = CoordinateSystem.XAxis(coordinateSystem=watch_2)
YAxis_2 = CoordinateSystem.YAxis(coordinateSystem=watch_2)
ZAxis_2 = CoordinateSystem.ZAxis(coordinateSystem=watch_2)
list_create_3 = List.Create(item0=XAxis_2, item1=YAxis_2, item2=ZAxis_2)
isAlmostEqualTo = Vector.IsAlmostEqualTo(vector=list_create_2, otherVector=list_create_3)
XScaleFactor = CoordinateSystem.XScaleFactor(coordinateSystem=watch)
YScaleFactor = CoordinateSystem.YScaleFactor(coordinateSystem=watch)
ZScaleFactor = CoordinateSystem.ZScaleFactor(coordinateSystem=watch)
list_create_4 = List.Create(item0=XScaleFactor, item1=YScaleFactor, item2=ZScaleFactor)
XScaleFactor_2 = CoordinateSystem.XScaleFactor(coordinateSystem=watch_2)
YScaleFactor_2 = CoordinateSystem.YScaleFactor(coordinateSystem=watch_2)
ZScaleFactor_2 = CoordinateSystem.ZScaleFactor(coordinateSystem=watch_2)
list_create_5 = List.Create(item0=XScaleFactor_2, item1=YScaleFactor_2, item2=ZScaleFactor_2)
eq_2 = Equals(x=list_create_4, y=list_create_5)
origin = CoordinateSystem.Origin(coordinateSystem=watch)
origin_2 = CoordinateSystem.Origin(coordinateSystem=watch_2)
isAlmostEqualTo_2 = Geometry.IsAlmostEqualTo(geometry=origin, other=origin_2)

code_block_2 = CodeBlock { 1; 2; 3; }
scale_2 = CoordinateSystem.Scale(coordinateSystem=rotate, xamount=code_block_2.out0, yamount=code_block_2.out1, zamount=code_block_2.out2)
stringifyJSON_3 = Data.StringifyJSON(values=scale_2)
parseJSON_3 = Data.ParseJSON(json=stringifyJSON_3)

# group: Coordinate Properties
watch_3 = Watch(scale_2)
XAxis_3 = CoordinateSystem.XAxis(coordinateSystem=watch_3)
YAxis_3 = CoordinateSystem.YAxis(coordinateSystem=watch_3)
ZAxis_3 = CoordinateSystem.ZAxis(coordinateSystem=watch_3)
list_create_6 = List.Create(item0=XAxis_3, item1=YAxis_3, item2=ZAxis_3)
watch_4 = Watch(parseJSON_3)
XAxis_4 = CoordinateSystem.XAxis(coordinateSystem=watch_4)
YAxis_4 = CoordinateSystem.YAxis(coordinateSystem=watch_4)
ZAxis_4 = CoordinateSystem.ZAxis(coordinateSystem=watch_4)
list_create_7 = List.Create(item0=XAxis_4, item1=YAxis_4, item2=ZAxis_4)
isAlmostEqualTo_3 = Vector.IsAlmostEqualTo(vector=list_create_6, otherVector=list_create_7)
XScaleFactor_3 = CoordinateSystem.XScaleFactor(coordinateSystem=watch_3)
YScaleFactor_3 = CoordinateSystem.YScaleFactor(coordinateSystem=watch_3)
ZScaleFactor_3 = CoordinateSystem.ZScaleFactor(coordinateSystem=watch_3)
list_create_8 = List.Create(item0=XScaleFactor_3, item1=YScaleFactor_3, item2=ZScaleFactor_3)
XScaleFactor_4 = CoordinateSystem.XScaleFactor(coordinateSystem=watch_4)
YScaleFactor_4 = CoordinateSystem.YScaleFactor(coordinateSystem=watch_4)
ZScaleFactor_4 = CoordinateSystem.ZScaleFactor(coordinateSystem=watch_4)
list_create_9 = List.Create(item0=XScaleFactor_4, item1=YScaleFactor_4, item2=ZScaleFactor_4)
eq_3 = Equals(x=list_create_8, y=list_create_9)
origin_3 = CoordinateSystem.Origin(coordinateSystem=watch_3)
origin_4 = CoordinateSystem.Origin(coordinateSystem=watch_4)
isAlmostEqualTo_4 = Geometry.IsAlmostEqualTo(geometry=origin_3, other=origin_4)

list_create_10 = List.Create(item0=list_create, item1=isAlmostEqualTo, item2=eq_2, item3=isAlmostEqualTo_3, item4=eq_3, item5=isAlmostEqualTo_2, item6=isAlmostEqualTo_4)
flatten = List.Flatten(list=list_create_10)

# group: All True
allTrue = List.AllTrue(list=flatten)

# group: Todo... Determine why IsEquals is false. All props are identical
isEqualTo_2 = CoordinateSystem.IsEqualTo(coordinateSystem=rotate, other=parseJSON_2)

# group: Todo... Determine why IsEquals is false. All props are identical
isEqualTo_3 = CoordinateSystem.IsEqualTo(coordinateSystem=scale_2, other=parseJSON_3)
