# Dynamo graph Abstract_Plane_JSONParsing.dyn (Dynamo 3.0.0.5795)

reverse = Curve.Reverse()  # unwired: curve
number = DoubleInput(2)
byCoordinates = Point.ByCoordinates(x=number, y=number, z=number)
code_block = CodeBlock { 1; 2.3; 4; }
byCoordinates_2 = Vector.ByCoordinates(x=code_block.out0, y=code_block.out1, z=code_block.out2)
byOriginNormal = Plane.ByOriginNormal(origin=byCoordinates, normal=byCoordinates_2)
stringifyJSON = Data.StringifyJSON(values=byOriginNormal)
parseJSON = Data.ParseJSON(json=stringifyJSON)
isAlmostEqualTo = Geometry.IsAlmostEqualTo(geometry=byOriginNormal, other=parseJSON)
XZ = Plane.XZ()
mirror = Geometry.Mirror(geometry=byOriginNormal, mirrorPlane=XZ)
stringifyJSON_2 = Data.StringifyJSON(values=mirror)
parseJSON_2 = Data.ParseJSON(json=stringifyJSON_2)
isAlmostEqualTo_2 = Geometry.IsAlmostEqualTo(geometry=mirror, other=parseJSON_2)
byOrigin = CoordinateSystem.ByOrigin()
code_block_2 = CodeBlock { 2; 3; 4; }
byOrigin_2 = CoordinateSystem.ByOrigin(x=code_block_2.out0, y=code_block_2.out1, z=code_block_2.out2)
byCoordinates_3 = Point.ByCoordinates()
byCoordinates_4 = Vector.ByCoordinates(x=code_block_2.out0, y=code_block_2.out2)
number_2 = DoubleInput(24)
rotate = CoordinateSystem.Rotate(coordinateSystem=byOrigin_2, origin=byCoordinates_3, axis=byCoordinates_4, degrees=number_2)
number_3 = DoubleInput(2.3)
scale = CoordinateSystem.Scale(coordinateSystem=rotate, amount=number_3)
transform = Geometry.Transform(geometry=byOriginNormal, fromCoordinateSystem=byOrigin, contextCoordinateSystem=scale)
stringifyJSON_3 = Data.StringifyJSON(values=transform)
parseJSON_3 = Data.ParseJSON(json=stringifyJSON_3)
isAlmostEqualTo_3 = Geometry.IsAlmostEqualTo(geometry=transform, other=parseJSON_3)
type = Object.Type(object=byOriginNormal)
type_2 = Object.Type(object=parseJSON)
eq = type == type_2
list_create = List.Create(item0=isAlmostEqualTo, item1=isAlmostEqualTo_2, item2=isAlmostEqualTo_3, item3=eq)

# group: All True
allTrue = List.AllTrue(list=list_create)
