# Dynamo graph Abstract_Vector_JSONParsing.dyn "Abstract-Vector_JSONParsing" (Dynamo 3.0.0.5795)

code_block = CodeBlock { 3.1; 4.3; 5.99; }
byCoordinates = Vector.ByCoordinates(x=code_block.out0, y=code_block.out1, z=code_block.out2)
stringifyJSON = Data.StringifyJSON(values=byCoordinates)
parseJSON = Data.ParseJSON(json=stringifyJSON)
isAlmostEqualTo = Vector.IsAlmostEqualTo(vector=byCoordinates, otherVector=parseJSON)
type = Object.Type(object=byCoordinates)
type_2 = Object.Type(object=parseJSON)
eq = type == type_2
list_create = List.Create(item0=isAlmostEqualTo, item1=eq)

# group: All True For Vector
allTrue = List.AllTrue(list=list_create)
