# Dynamo graph Curve_Arc_JSONParsing.dyn (Dynamo 3.0.0.5795)

number = DoubleInput(2)
byCoordinates = Point.ByCoordinates(x=number, y=number, z=number)
byCoordinates_2 = Point.ByCoordinates(y=number)
code_block = CodeBlock { 80; }
number_2 = DoubleInput(1)
byCoordinates_3 = Vector.ByCoordinates(x=number_2, y=number, z=number)
byCenterPointStartPointSweepAngle = Arc.ByCenterPointStartPointSweepAngle(centerPoint=byCoordinates, startPoint=byCoordinates_2, sweepAngle=code_block, normal=byCoordinates_3)
type = Object.Type(object=byCenterPointStartPointSweepAngle)
stringifyJSON = Data.StringifyJSON(values=byCenterPointStartPointSweepAngle)
parseJSON = Data.ParseJSON(json=stringifyJSON)
type_2 = Object.Type(object=parseJSON)
eq = type == type_2
isAlmostEqualTo = Geometry.IsAlmostEqualTo(geometry=byCenterPointStartPointSweepAngle, other=parseJSON)
XZ = Plane.XZ()
mirror = Geometry.Mirror(geometry=byCenterPointStartPointSweepAngle, mirrorPlane=XZ)
stringifyJSON_2 = Data.StringifyJSON(values=mirror)
parseJSON_2 = Data.ParseJSON(json=stringifyJSON_2)
isAlmostEqualTo_2 = Geometry.IsAlmostEqualTo(geometry=mirror, other=parseJSON_2)
list_create = List.Create(item0=eq, item1=isAlmostEqualTo, item2=isAlmostEqualTo_2)
reverse = Curve.Reverse(curve=byCenterPointStartPointSweepAngle)
stringifyJSON_3 = Data.StringifyJSON(values=reverse)
parseJSON_3 = Data.ParseJSON(json=stringifyJSON_3)

# group: Check Arc Props
watch = Watch(reverse)
startPoint = Curve.StartPoint(curve=watch)
endPoint = Curve.EndPoint(curve=watch)
join = List.Join(list0=startPoint, list1=endPoint)
watch_2 = Watch(parseJSON_3)
startPoint_2 = Curve.StartPoint(curve=watch_2)
endPoint_2 = Curve.EndPoint(curve=watch_2)
join_2 = List.Join(list0=startPoint_2, list1=endPoint_2)
isAlmostEqualTo_3 = Geometry.IsAlmostEqualTo(geometry=join, other=join_2)
sweepAngle = Arc.SweepAngle(arc=watch)
radius = Arc.Radius(arc=watch)
join_3 = List.Join(list0=sweepAngle, list1=radius)
sweepAngle_2 = Arc.SweepAngle(arc=watch_2)
radius_2 = Arc.Radius(arc=watch_2)
join_4 = List.Join(list0=sweepAngle_2, list1=radius_2)
eq_2 = Equals(x=join_3, y=join_4)
normal = Curve.Normal(curve=watch)
normal_2 = Curve.Normal(curve=watch_2)
isAlmostEqualTo_4 = Vector.IsAlmostEqualTo(vector=normal, otherVector=normal_2)
join_5 = List.Join(list0=isAlmostEqualTo_3, list1=eq_2, list2=isAlmostEqualTo_4)
allTrue = List.AllTrue(list=join_5)
startAngle = Arc.StartAngle(arc=watch)
startAngle_2 = Arc.StartAngle(arc=watch_2)
eq_3 = Equals(x=startAngle, y=startAngle_2)

byOrigin = CoordinateSystem.ByOrigin()
code_block_2 = CodeBlock { 2; 3; 4; }
byOrigin_2 = CoordinateSystem.ByOrigin(x=code_block_2.out0, y=code_block_2.out1, z=code_block_2.out2)
byCoordinates_4 = Point.ByCoordinates()
byCoordinates_5 = Vector.ByCoordinates(x=code_block_2.out0, y=code_block_2.out2)
number_3 = DoubleInput(24)
rotate = CoordinateSystem.Rotate(coordinateSystem=byOrigin_2, origin=byCoordinates_4, axis=byCoordinates_5, degrees=number_3)
number_4 = DoubleInput(2.3)
scale = CoordinateSystem.Scale(coordinateSystem=rotate, amount=number_4)
transform = Geometry.Transform(geometry=byCenterPointStartPointSweepAngle, fromCoordinateSystem=byOrigin, contextCoordinateSystem=scale)
stringifyJSON_4 = Data.StringifyJSON(values=transform)
parseJSON_4 = Data.ParseJSON(json=stringifyJSON_4)

# group: Check Arc Props
watch_3 = Watch(transform)
startPoint_3 = Curve.StartPoint(curve=watch_3)
endPoint_3 = Curve.EndPoint(curve=watch_3)
join_6 = List.Join(list0=startPoint_3, list1=endPoint_3)
watch_4 = Watch(parseJSON_4)
startPoint_4 = Curve.StartPoint(curve=watch_4)
endPoint_4 = Curve.EndPoint(curve=watch_4)
join_7 = List.Join(list0=startPoint_4, list1=endPoint_4)
isAlmostEqualTo_5 = Geometry.IsAlmostEqualTo(geometry=join_6, other=join_7)
sweepAngle_3 = Arc.SweepAngle(arc=watch_3)
radius_3 = Arc.Radius(arc=watch_3)
join_8 = List.Join(list0=sweepAngle_3, list1=radius_3)
sweepAngle_4 = Arc.SweepAngle(arc=watch_4)
radius_4 = Arc.Radius(arc=watch_4)
join_9 = List.Join(list0=sweepAngle_4, list1=radius_4)
eq_4 = Equals(x=join_8, y=join_9)
normal_3 = Curve.Normal(curve=watch_3)
normal_4 = Curve.Normal(curve=watch_4)
isAlmostEqualTo_6 = Vector.IsAlmostEqualTo(vector=normal_3, otherVector=normal_4)
join_10 = List.Join(list0=isAlmostEqualTo_5, list1=eq_4, list2=isAlmostEqualTo_6)
allTrue_2 = List.AllTrue(list=join_10)
startAngle_3 = Arc.StartAngle(arc=watch_3)
startAngle_4 = Arc.StartAngle(arc=watch_4)
eq_5 = Equals(x=startAngle_3, y=startAngle_4)

list_create_2 = List.Create(item0=list_create, item1=allTrue, item2=allTrue_2)
flatten = List.Flatten(list=list_create_2)

# group: All True
list_alltrue_final = List.AllTrue(list=flatten)

isAlmostEqualTo_7 = Geometry.IsAlmostEqualTo(geometry=reverse, other=parseJSON_3)
isAlmostEqualTo_8 = Geometry.IsAlmostEqualTo(geometry=transform, other=parseJSON_4)
list_create_3 = List.Create(item0=isAlmostEqualTo_7, item1=eq_3, item2=isAlmostEqualTo_8, item3=eq_5)

# group: All False
allFalse = List.AllFalse(list=list_create_3)
