# Dynamo graph Curve_Circle_JSONParsing.dyn (Dynamo 3.0.0.5795)

code_block = CodeBlock { 1; 2; 3; }
byCoordinates = Point.ByCoordinates(x=code_block.out0, y=code_block.out1, z=code_block.out2)
byCoordinates_2 = Vector.ByCoordinates(x=code_block.out0, y=code_block.out1, z=code_block.out2)
byCenterPointRadiusNormal = Circle.ByCenterPointRadiusNormal(centerPoint=byCoordinates, radius=code_block.out2, normal=byCoordinates_2)
stringifyJSON = Data.StringifyJSON(values=byCenterPointRadiusNormal)
parseJSON = Data.ParseJSON(json=stringifyJSON)
isAlmostEqualTo = Geometry.IsAlmostEqualTo(geometry=byCenterPointRadiusNormal, other=parseJSON)
reverse = Curve.Reverse(curve=byCenterPointRadiusNormal)
stringifyJSON_2 = Data.StringifyJSON(values=reverse)
parseJSON_2 = Data.ParseJSON(json=stringifyJSON_2)
isAlmostEqualTo_2 = Geometry.IsAlmostEqualTo(geometry=reverse, other=parseJSON_2)
XZ = Plane.XZ()
mirror = Geometry.Mirror(geometry=byCenterPointRadiusNormal, mirrorPlane=XZ)
stringifyJSON_3 = Data.StringifyJSON(values=mirror)
parseJSON_3 = Data.ParseJSON(json=stringifyJSON_3)
isAlmostEqualTo_3 = Geometry.IsAlmostEqualTo(geometry=mirror, other=parseJSON_3)
byOrigin = CoordinateSystem.ByOrigin()
code_block_2 = CodeBlock { 2; 3; 4; }
byOrigin_2 = CoordinateSystem.ByOrigin(x=code_block_2.out0, y=code_block_2.out1, z=code_block_2.out2)
byCoordinates_3 = Point.ByCoordinates()
byCoordinates_4 = Vector.ByCoordinates(x=code_block_2.out0, y=code_block_2.out2)
number = DoubleInput(24)
rotate = CoordinateSystem.Rotate(coordinateSystem=byOrigin_2, origin=byCoordinates_3, axis=byCoordinates_4, degrees=number)
number_2 = DoubleInput(2.3)
scale = CoordinateSystem.Scale(coordinateSystem=rotate, amount=number_2)
transform = Geometry.Transform(geometry=byCenterPointRadiusNormal, fromCoordinateSystem=byOrigin, contextCoordinateSystem=scale)
stringifyJSON_4 = Data.StringifyJSON(values=transform)
parseJSON_4 = Data.ParseJSON(json=stringifyJSON_4)
isAlmostEqualTo_4 = Geometry.IsAlmostEqualTo(geometry=transform, other=parseJSON_4)
type = Object.Type(object=byCenterPointRadiusNormal)
type_2 = Object.Type(object=parseJSON)
eq = type == type_2
list_create = List.Create(item0=isAlmostEqualTo, item1=isAlmostEqualTo_2, item2=isAlmostEqualTo_3, item3=isAlmostEqualTo_4, item4=eq)

# group: All True
allTrue = List.AllTrue(list=list_create)
