# Dynamo graph Curve_EllipseArc_JSONParsing.dyn (Dynamo 3.0.0.5795)

code_block = CodeBlock { 2; 3; 4; }
byOrigin = CoordinateSystem.ByOrigin(x=code_block.out0, y=code_block.out1, z=code_block.out2)
byCoordinates = Point.ByCoordinates()
byCoordinates_2 = Vector.ByCoordinates(x=code_block.out0, y=code_block.out2)
number = DoubleInput(24)
rotate = CoordinateSystem.Rotate(coordinateSystem=byOrigin, origin=byCoordinates, axis=byCoordinates_2, degrees=number)
XYPlane = CoordinateSystem.XYPlane(coordinateSystem=rotate)
code_block_2 = CodeBlock { 2.4; 4; 35; 120; }
byPlaneRadiiAngles = EllipseArc.ByPlaneRadiiAngles(plane=XYPlane, xRadius=code_block_2.out1, yRadius=code_block_2.out0, startAngle=code_block_2.out2, sweepAngle=code_block_2.out3)
stringifyJSON = Data.StringifyJSON(values=byPlaneRadiiAngles)
parseJSON = Data.ParseJSON(json=stringifyJSON)
isAlmostEqualTo = Geometry.IsAlmostEqualTo(geometry=byPlaneRadiiAngles, other=parseJSON)
byPlaneRadiiAngles_2 = EllipseArc.ByPlaneRadiiAngles(plane=XYPlane, xRadius=code_block_2.out0, yRadius=code_block_2.out1, startAngle=code_block_2.out2, sweepAngle=code_block_2.out3)
join = List.Join(list0=byPlaneRadiiAngles, list1=byPlaneRadiiAngles_2)
XZ = Plane.XZ()
mirror = Geometry.Mirror(geometry=join, mirrorPlane=XZ)
stringifyJSON_2 = Data.StringifyJSON(values=mirror)
parseJSON_2 = Data.ParseJSON(json=stringifyJSON_2)
isAlmostEqualTo_2 = Geometry.IsAlmostEqualTo(geometry=mirror, other=parseJSON_2)
byOrigin_2 = CoordinateSystem.ByOrigin()
number_2 = DoubleInput(2.3)
scale = CoordinateSystem.Scale(coordinateSystem=rotate, amount=number_2)
transform = Geometry.Transform(geometry=join, fromCoordinateSystem=byOrigin_2, contextCoordinateSystem=scale)
stringifyJSON_3 = Data.StringifyJSON(values=transform)
parseJSON_3 = Data.ParseJSON(json=stringifyJSON_3)
isAlmostEqualTo_3 = Geometry.IsAlmostEqualTo(geometry=transform, other=parseJSON_3)
type = Object.Type(object=byPlaneRadiiAngles)
type_2 = Object.Type(object=parseJSON)
eq = type == type_2
list_create = List.Create(item0=isAlmostEqualTo, item1=isAlmostEqualTo_2, item2=isAlmostEqualTo_3, item3=eq)
stringifyJSON_4 = Data.StringifyJSON(values=byPlaneRadiiAngles_2)
parseJSON_4 = Data.ParseJSON(json=stringifyJSON_4)

# group: Check Props
watch = Watch(byPlaneRadiiAngles_2)
startPoint = Curve.StartPoint(curve=watch)
endPoint = Curve.EndPoint(curve=watch)
join_2 = List.Join(list0=startPoint, list1=endPoint)
watch_2 = Watch(parseJSON_4)
startPoint_2 = Curve.StartPoint(curve=watch_2)
endPoint_2 = Curve.EndPoint(curve=watch_2)
join_3 = List.Join(list0=startPoint_2, list1=endPoint_2)
isAlmostEqualTo_4 = Geometry.IsAlmostEqualTo(geometry=join_2, other=join_3)
sweepAngle = EllipseArc.SweepAngle(ellipseArc=watch)
sweepAngle_2 = EllipseArc.SweepAngle(ellipseArc=watch_2)
eq_2 = Equals(x=sweepAngle, y=sweepAngle_2)
majorAxis = EllipseArc.MajorAxis(ellipseArc=watch)
minorAxis = EllipseArc.MinorAxis(ellipseArc=watch)
normal = Curve.Normal(curve=watch)
join_4 = List.Join(list0=majorAxis, list1=minorAxis, list2=normal)
majorAxis_2 = EllipseArc.MajorAxis(ellipseArc=watch_2)
minorAxis_2 = EllipseArc.MinorAxis(ellipseArc=watch_2)
normal_2 = Curve.Normal(curve=watch_2)
join_5 = List.Join(list0=majorAxis_2, list1=minorAxis_2, list2=normal_2)
isAlmostEqualTo_5 = Vector.IsAlmostEqualTo(vector=join_4, otherVector=join_5)
join_6 = List.Join(list0=isAlmostEqualTo_4, list1=eq_2, list2=isAlmostEqualTo_5)
allTrue = List.AllTrue(list=join_6)
startAngle = EllipseArc.StartAngle(ellipseArc=watch)
startAngle_2 = EllipseArc.StartAngle(ellipseArc=watch_2)
eq_3 = Equals(x=startAngle, y=startAngle_2)

reverse = Curve.Reverse(curve=byPlaneRadiiAngles_2)
stringifyJSON_5 = Data.StringifyJSON(values=reverse)
parseJSON_5 = Data.ParseJSON(json=stringifyJSON_5)

# group: Check Props
watch_3 = Watch(reverse)
startPoint_3 = Curve.StartPoint(curve=watch_3)
endPoint_3 = Curve.EndPoint(curve=watch_3)
join_7 = List.Join(list0=startPoint_3, list1=endPoint_3)
watch_4 = Watch(parseJSON_5)
startPoint_4 = Curve.StartPoint(curve=watch_4)
endPoint_4 = Curve.EndPoint(curve=watch_4)
join_8 = List.Join(list0=startPoint_4, list1=endPoint_4)
isAlmostEqualTo_6 = Geometry.IsAlmostEqualTo(geometry=join_7, other=join_8)
sweepAngle_3 = EllipseArc.SweepAngle(ellipseArc=watch_3)
sweepAngle_4 = EllipseArc.SweepAngle(ellipseArc=watch_4)
eq_4 = Equals(x=sweepAngle_3, y=sweepAngle_4)
majorAxis_3 = EllipseArc.MajorAxis(ellipseArc=watch_3)
minorAxis_3 = EllipseArc.MinorAxis(ellipseArc=watch_3)
normal_3 = Curve.Normal(curve=watch_3)
join_9 = List.Join(list0=majorAxis_3, list1=minorAxis_3, list2=normal_3)
majorAxis_4 = EllipseArc.MajorAxis(ellipseArc=watch_4)
minorAxis_4 = EllipseArc.MinorAxis(ellipseArc=watch_4)
normal_4 = Curve.Normal(curve=watch_4)
join_10 = List.Join(list0=majorAxis_4, list1=minorAxis_4, list2=normal_4)
isAlmostEqualTo_7 = Vector.IsAlmostEqualTo(vector=join_9, otherVector=join_10)
join_11 = List.Join(list0=isAlmostEqualTo_6, list1=eq_4, list2=isAlmostEqualTo_7)
allTrue_2 = List.AllTrue(list=join_11)
startAngle_3 = EllipseArc.StartAngle(ellipseArc=watch_3)
startAngle_4 = EllipseArc.StartAngle(ellipseArc=watch_4)
eq_5 = Equals(x=startAngle_3, y=startAngle_4)

reverse_2 = Curve.Reverse(curve=byPlaneRadiiAngles)
stringifyJSON_6 = Data.StringifyJSON(values=reverse_2)
parseJSON_6 = Data.ParseJSON(json=stringifyJSON_6)

# group: Check Props
watch_5 = Watch(reverse_2)
startPoint_5 = Curve.StartPoint(curve=watch_5)
endPoint_5 = Curve.EndPoint(curve=watch_5)
join_12 = List.Join(list0=startPoint_5, list1=endPoint_5)
watch_6 = Watch(parseJSON_6)
startPoint_6 = Curve.StartPoint(curve=watch_6)
endPoint_6 = Curve.EndPoint(curve=watch_6)
join_13 = List.Join(list0=startPoint_6, list1=endPoint_6)
isAlmostEqualTo_8 = Geometry.IsAlmostEqualTo(geometry=join_12, other=join_13)
sweepAngle_5 = EllipseArc.SweepAngle(ellipseArc=watch_5)
sweepAngle_6 = EllipseArc.SweepAngle(ellipseArc=watch_6)
eq_6 = Equals(x=sweepAngle_5, y=sweepAngle_6)
majorAxis_5 = EllipseArc.MajorAxis(ellipseArc=watch_5)
minorAxis_5 = EllipseArc.MinorAxis(ellipseArc=watch_5)
normal_5 = Curve.Normal(curve=watch_5)
join_14 = List.Join(list0=majorAxis_5, list1=minorAxis_5, list2=normal_5)
majorAxis_6 = EllipseArc.MajorAxis(ellipseArc=watch_6)
minorAxis_6 = EllipseArc.MinorAxis(ellipseArc=watch_6)
normal_6 = Curve.Normal(curve=watch_6)
join_15 = List.Join(list0=majorAxis_6, list1=minorAxis_6, list2=normal_6)
isAlmostEqualTo_9 = Vector.IsAlmostEqualTo(vector=join_14, otherVector=join_15)
join_16 = List.Join(list0=isAlmostEqualTo_8, list1=eq_6, list2=isAlmostEqualTo_9)
allTrue_3 = List.AllTrue(list=join_16)
startAngle_5 = EllipseArc.StartAngle(ellipseArc=watch_5)
startAngle_6 = EllipseArc.StartAngle(ellipseArc=watch_6)
eq_7 = Equals(x=startAngle_5, y=startAngle_6)

list_create_2 = List.Create(item0=list_create, item1=allTrue, item2=allTrue_2, item3=allTrue_3)
flatten = List.Flatten(list=list_create_2)

# group: All True
list_alltrue_final = List.AllTrue(list=flatten)

isAlmostEqualTo_10 = Geometry.IsAlmostEqualTo(geometry=byPlaneRadiiAngles_2, other=parseJSON_4)
isAlmostEqualTo_11 = Geometry.IsAlmostEqualTo(geometry=reverse, other=parseJSON_5)
isAlmostEqualTo_12 = Geometry.IsAlmostEqualTo(geometry=reverse_2, other=parseJSON_6)
list_create_3 = List.Create(item0=isAlmostEqualTo_10, item1=isAlmostEqualTo_11, item2=isAlmostEqualTo_12)
list_create_4 = List.Create(item0=list_create_3, item1=eq_3, item2=eq_5, item3=eq_7)
flatten_2 = List.Flatten(list=list_create_4)

# group: All False
allFalse = List.AllFalse(list=flatten_2)
