# Dynamo graph Curve_Ellipse_JSONParsing.dyn (Dynamo 3.0.0.5795)

code_block = CodeBlock { 2; 3; 4; }
byOrigin = CoordinateSystem.ByOrigin(x=code_block.out0, y=code_block.out1, z=code_block.out2)
byCoordinates = Point.ByCoordinates()
byCoordinates_2 = Vector.ByCoordinates(x=code_block.out0, y=code_block.out2)
number = DoubleInput(24)
rotate = CoordinateSystem.Rotate(coordinateSystem=byOrigin, origin=byCoordinates, axis=byCoordinates_2, degrees=number)
code_block_2 = CodeBlock { 2.4; 4; }
byCoordinateSystemRadii = Ellipse.ByCoordinateSystemRadii(origin=rotate, xAxisRadius=code_block_2.out0, yAxisRadius=code_block_2.out1)
byCoordinateSystemRadii_2 = Ellipse.ByCoordinateSystemRadii(origin=rotate, xAxisRadius=code_block_2.out1, yAxisRadius=code_block_2.out0)
join = List.Join(list0=byCoordinateSystemRadii, list1=byCoordinateSystemRadii_2)
stringifyJSON = Data.StringifyJSON(values=join)
parseJSON = Data.ParseJSON(json=stringifyJSON)
isAlmostEqualTo = Geometry.IsAlmostEqualTo(geometry=join, other=parseJSON)
reverse = Curve.Reverse(curve=join)
stringifyJSON_2 = Data.StringifyJSON(values=reverse)
parseJSON_2 = Data.ParseJSON(json=stringifyJSON_2)
isAlmostEqualTo_2 = Geometry.IsAlmostEqualTo(geometry=reverse, other=parseJSON_2)
XZ = Plane.XZ()
mirror = Geometry.Mirror(geometry=join, mirrorPlane=XZ)
stringifyJSON_3 = Data.StringifyJSON(values=mirror)
parseJSON_3 = Data.ParseJSON(json=stringifyJSON_3)
isAlmostEqualTo_3 = Geometry.IsAlmostEqualTo(geometry=mirror, other=parseJSON_3)
byOrigin_2 = CoordinateSystem.ByOrigin()
number_2 = DoubleInput(2.3)
scale = CoordinateSystem.Scale(coordinateSystem=rotate, amount=number_2)
transform = Geometry.Transform(geometry=join, fromCoordinateSystem=byOrigin_2, contextCoordinateSystem=scale)
stringifyJSON_4 = Data.StringifyJSON(values=transform)
parseJSON_4 = Data.ParseJSON(json=stringifyJSON_4)
isAlmostEqualTo_4 = Geometry.IsAlmostEqualTo(geometry=transform, other=parseJSON_4)
type = Object.Type(object=join)
type_2 = Object.Type(object=parseJSON)
eq = type == type_2
list_create = List.Create(item0=isAlmostEqualTo, item1=isAlmostEqualTo_2, item2=isAlmostEqualTo_3, item3=isAlmostEqualTo_4, item4=eq)
flatten = List.Flatten(list=list_create)

# group: All True
allTrue = List.AllTrue(list=flatten)
