# Dynamo graph Curve_Helix_JSONParsing.dyn (Dynamo 3.0.0.5795)

code_block = CodeBlock { 1; 2; 3; }
byCoordinates = Vector.ByCoordinates(x=code_block.out0, y=code_block.out1, z=code_block.out2)
byAxis = Helix.ByAxis(axisDirection=byCoordinates)
stringifyJSON = Data.StringifyJSON(values=byAxis)
parseJSON = Data.ParseJSON(json=stringifyJSON)
isAlmostEqualTo = Geometry.IsAlmostEqualTo(geometry=byAxis, other=parseJSON)
reverse = Curve.Reverse(curve=byAxis)
stringifyJSON_2 = Data.StringifyJSON(values=reverse)
parseJSON_2 = Data.ParseJSON(json=stringifyJSON_2)
isAlmostEqualTo_2 = Geometry.IsAlmostEqualTo(geometry=reverse, other=parseJSON_2)
XZ = Plane.XZ()
mirror = Geometry.Mirror(geometry=byAxis, mirrorPlane=XZ)
stringifyJSON_3 = Data.StringifyJSON(values=mirror)
parseJSON_3 = Data.ParseJSON(json=stringifyJSON_3)
isAlmostEqualTo_3 = Geometry.IsAlmostEqualTo(geometry=mirror, other=parseJSON_3)
byOrigin = CoordinateSystem.ByOrigin()
code_block_2 = CodeBlock { 2; 3; 4; }
byOrigin_2 = CoordinateSystem.ByOrigin(x=code_block_2.out0, y=code_block_2.out1, z=code_block_2.out2)
byCoordinates_2 = Point.ByCoordinates()
byCoordinates_3 = Vector.ByCoordinates(x=code_block_2.out0, y=code_block_2.out2)
number = DoubleInput(24)
rotate = CoordinateSystem.Rotate(coordinateSystem=byOrigin_2, origin=byCoordinates_2, axis=byCoordinates_3, degrees=number)
number_2 = DoubleInput(2.3)
scale = CoordinateSystem.Scale(coordinateSystem=rotate, amount=number_2)
transform = Geometry.Transform(geometry=byAxis, fromCoordinateSystem=byOrigin, contextCoordinateSystem=scale)
stringifyJSON_4 = Data.StringifyJSON(values=transform)
parseJSON_4 = Data.ParseJSON(json=stringifyJSON_4)
isAlmostEqualTo_4 = Geometry.IsAlmostEqualTo(geometry=transform, other=parseJSON_4)
list_create = List.Create(item0=isAlmostEqualTo, item1=isAlmostEqualTo_2, item2=isAlmostEqualTo_3, item3=isAlmostEqualTo_4)

# group: All True
allTrue = List.AllTrue(list=list_create)

type = Object.Type(object=byAxis)
type_2 = Object.Type(object=parseJSON)
eq = type == type_2

# group: All False
allFalse = List.AllFalse(list=eq)
