# Dynamo graph Curve_NurbsCurve_JSONParsing.dyn (Dynamo 3.0.0.5795)

# group: Autodesk.DesignScript.Geometry.NurbsCurve.ByControlPointsWeightsKnots
# Inserted Dynamo graph
code_block = CodeBlock { 9; 0; 1; 3; 5; }
randomList = Math.RandomList(amount=code_block.out0, value1=code_block.out1, value2=code_block.out2, seed=code_block.out3)
formula = CodeBlock(x=randomList) { temp_proc_var_ = x * 20; }
sort = List.Sort(list=formula)
randomList_2 = Math.RandomList(amount=code_block.out0, value1=code_block.out1, value2=code_block.out2, seed=code_block.out4)
formula_2 = CodeBlock(y=randomList_2) { temp_proc_var_ = y * 20; }
sort_2 = List.Sort(list=formula_2)
byCoordinates = Point.ByCoordinates(x=sort, y=sort_2)
byPoints = NurbsCurve.ByPoints(points=byCoordinates)
controlPoints = NurbsCurve.ControlPoints(nurbsCurve=byPoints)
weights = NurbsCurve.Weights(nurbsCurve=byPoints)
code_block_2 = CodeBlock { 2; 10; }
replaceItemAtIndex = List.ReplaceItemAtIndex(list=weights, index=code_block_2.out0, item=code_block_2.out1)
knots = NurbsCurve.Knots(nurbsCurve=byPoints)
code_block_3 = CodeBlock { 3; }
byControlPointsWeightsKnots = NurbsCurve.ByControlPointsWeightsKnots(points=controlPoints, weights=replaceItemAtIndex, knots=knots, degree=code_block_3)

# group: Autodesk.DesignScript.Geometry.NurbsCurve.ByControlPoints(points, degree, closeCurve)
# Inserted Dynamo graph
code_block_4 = CodeBlock { 6; 0; 1; 3; 5; }
randomList_3 = Math.RandomList(amount=code_block_4.out0, value1=code_block_4.out1, value2=code_block_4.out2, seed=code_block_4.out3)
code_block_5 = CodeBlock(x=randomList_3) { x*15; }
sort_3 = List.Sort(list=code_block_5)
randomList_4 = Math.RandomList(amount=code_block_4.out0, value1=code_block_4.out1, value2=code_block_4.out2, seed=code_block_4.out4)
code_block_6 = CodeBlock(x=randomList_4) { x*15; }
sort_4 = List.Sort(list=code_block_6)
byCoordinates_2 = Point.ByCoordinates(x=sort_3, y=sort_4)
code_block_7 = CodeBlock { 3; }
byControlPoints = NurbsCurve.ByControlPoints(points=byCoordinates_2, degree=code_block_7)
boolean = BoolSelector(true)  # graph input
byControlPoints_2 = NurbsCurve.ByControlPoints(points=byCoordinates_2, degree=code_block_7, closeCurve=boolean)

byControlPoints_3 = NurbsCurve.ByControlPoints(points=byCoordinates_2)
byControlPoints_4 = NurbsCurve.ByControlPoints(points=byCoordinates_2)
list_create = List.Create(item0=byControlPointsWeightsKnots, item1=byControlPoints, item2=byControlPoints_2, item3=byControlPoints_3, item4=byControlPoints_4)
stringifyJSON = Data.StringifyJSON(values=list_create)
parseJSON = Data.ParseJSON(json=stringifyJSON)
isAlmostEqualTo = Geometry.IsAlmostEqualTo(geometry=list_create, other=parseJSON)
type = Object.Type(object=list_create)
type_2 = Object.Type(object=parseJSON)
eq = type == type_2
list_create_2 = List.Create(item0=isAlmostEqualTo, item1=eq)
flatten = List.Flatten(list=list_create_2)
reverse = Curve.Reverse(curve=byControlPointsWeightsKnots)
stringifyJSON_2 = Data.StringifyJSON(values=reverse)
parseJSON_2 = Data.ParseJSON(json=stringifyJSON_2)
isAlmostEqualTo_2 = Geometry.IsAlmostEqualTo(geometry=reverse, other=parseJSON_2)
XZ = Plane.XZ()
mirror = Geometry.Mirror(geometry=byControlPoints, mirrorPlane=XZ)
stringifyJSON_3 = Data.StringifyJSON(values=mirror)
parseJSON_3 = Data.ParseJSON(json=stringifyJSON_3)
isAlmostEqualTo_3 = Geometry.IsAlmostEqualTo(geometry=mirror, other=parseJSON_3)
byOrigin = CoordinateSystem.ByOrigin()
code_block_8 = CodeBlock { 2; 3; 4; }
byOrigin_2 = CoordinateSystem.ByOrigin(x=code_block_8.out0, y=code_block_8.out1, z=code_block_8.out2)
byCoordinates_3 = Point.ByCoordinates()
byCoordinates_4 = Vector.ByCoordinates(x=code_block_8.out0, y=code_block_8.out2)
number = DoubleInput(24)
rotate = CoordinateSystem.Rotate(coordinateSystem=byOrigin_2, origin=byCoordinates_3, axis=byCoordinates_4, degrees=number)
number_2 = DoubleInput(2.3)
scale = CoordinateSystem.Scale(coordinateSystem=rotate, amount=number_2)
transform = Geometry.Transform(geometry=byControlPoints, fromCoordinateSystem=byOrigin, contextCoordinateSystem=scale)
stringifyJSON_4 = Data.StringifyJSON(values=transform)
parseJSON_4 = Data.ParseJSON(json=stringifyJSON_4)
isAlmostEqualTo_4 = Geometry.IsAlmostEqualTo(geometry=transform, other=parseJSON_4)
list_create_3 = List.Create(item0=flatten, item1=isAlmostEqualTo_2, item2=isAlmostEqualTo_3, item3=isAlmostEqualTo_4)
flatten_2 = List.Flatten(list=list_create_3)

# group: All True
allTrue = List.AllTrue(list=flatten_2)
