# Dynamo graph Curve_PolyCurve_JSONParsing.dyn (Dynamo 3.0.0.5795)

byCoordinates = Point.ByCoordinates()
number = DoubleInput(180)
byCenterPointStartPointSweepAngle = Arc.ByCenterPointStartPointSweepAngle(sweepAngle=number)
endPoint = Curve.EndPoint(curve=byCenterPointStartPointSweepAngle)
byStartPointEndPoint = Line.ByStartPointEndPoint(startPoint=byCoordinates, endPoint=endPoint)
list_create = List.Create(item0=byStartPointEndPoint, item1=byCenterPointStartPointSweepAngle)
byJoinedCurves = PolyCurve.ByJoinedCurves(curves=list_create)
code_block = CodeBlock { 6; 0; 15; 3; 5; -2; 4; }
randomList = Math.RandomList(amount=code_block.out0, value1=code_block.out1, value2=code_block.out2, seed=code_block.out3)
sort = List.Sort(list=randomList)
randomList_2 = Math.RandomList(amount=code_block.out0, value1=code_block.out5, value2=code_block.out6, seed=code_block.out4)
byCoordinates_2 = Point.ByCoordinates(x=sort, y=randomList_2)
boolean = BoolSelector(true)
byPoints = PolyCurve.ByPoints(points=byCoordinates_2, connectLastToFirst=boolean)
byPoints_2 = PolyCurve.ByPoints(points=byCoordinates_2)
list_create_2 = List.Create(item0=byJoinedCurves, item1=byPoints, item2=byPoints_2)
curves = PolyCurve.Curves(polyCurve=list_create_2)
stringifyJSON = Data.StringifyJSON(values=list_create_2)
parseJSON = Data.ParseJSON(json=stringifyJSON)
curves_2 = PolyCurve.Curves(polyCurve=parseJSON)
isAlmostEqualTo = Geometry.IsAlmostEqualTo(geometry=curves, other=curves_2)
type = Object.Type(object=list_create_2)
type_2 = Object.Type(object=parseJSON)
eq = type == type_2
list_create_3 = List.Create(item0=isAlmostEqualTo, item1=eq)
flatten = List.Flatten(list=list_create_3)
reverse = Curve.Reverse(curve=byJoinedCurves)
curves_3 = PolyCurve.Curves(polyCurve=reverse)
stringifyJSON_2 = Data.StringifyJSON(values=reverse)
parseJSON_2 = Data.ParseJSON(json=stringifyJSON_2)
curves_4 = PolyCurve.Curves(polyCurve=parseJSON_2)
isAlmostEqualTo_2 = Geometry.IsAlmostEqualTo(geometry=curves_3, other=curves_4)
XZ = Plane.XZ()
mirror = Geometry.Mirror(geometry=byJoinedCurves, mirrorPlane=XZ)
curves_5 = PolyCurve.Curves(polyCurve=mirror)
stringifyJSON_3 = Data.StringifyJSON(values=mirror)
parseJSON_3 = Data.ParseJSON(json=stringifyJSON_3)
curves_6 = PolyCurve.Curves(polyCurve=parseJSON_3)
isAlmostEqualTo_3 = Geometry.IsAlmostEqualTo(geometry=curves_5, other=curves_6)
byOrigin = CoordinateSystem.ByOrigin()
code_block_2 = CodeBlock { 2; 3; 4; }
byOrigin_2 = CoordinateSystem.ByOrigin(x=code_block_2.out0, y=code_block_2.out1, z=code_block_2.out2)
byCoordinates_3 = Point.ByCoordinates()
byCoordinates_4 = Vector.ByCoordinates(x=code_block_2.out0, y=code_block_2.out2)
number_2 = DoubleInput(24)
rotate = CoordinateSystem.Rotate(coordinateSystem=byOrigin_2, origin=byCoordinates_3, axis=byCoordinates_4, degrees=number_2)
number_3 = DoubleInput(2.3)
scale = CoordinateSystem.Scale(coordinateSystem=rotate, amount=number_3)
transform = Geometry.Transform(geometry=byJoinedCurves, fromCoordinateSystem=byOrigin, contextCoordinateSystem=scale)
curves_7 = PolyCurve.Curves(polyCurve=transform)
stringifyJSON_4 = Data.StringifyJSON(values=transform)
parseJSON_4 = Data.ParseJSON(json=stringifyJSON_4)
curves_8 = PolyCurve.Curves(polyCurve=parseJSON_4)
isAlmostEqualTo_4 = Geometry.IsAlmostEqualTo(geometry=curves_7, other=curves_8)
list_create_4 = List.Create(item0=flatten, item1=isAlmostEqualTo_2, item2=isAlmostEqualTo_3, item3=isAlmostEqualTo_4)
flatten_2 = List.Flatten(list=list_create_4)

# group: All True
allTrue = List.AllTrue(list=flatten_2)

# group: IS Almost does not work for PolyCurves
isAlmostEqualTo_5 = Geometry.IsAlmostEqualTo(geometry=list_create_2, other=parseJSON)
