# Dynamo graph Curve_Polygon_JSONParsing.dyn (Dynamo 3.0.0.5795)

code_block = CodeBlock { 1; 2; 3; }
byCoordinates = Point.ByCoordinates(x=code_block.out0, y=code_block.out1, z=code_block.out2)
byCoordinates_2 = Vector.ByCoordinates(x=code_block.out0, y=code_block.out1, z=code_block.out2)
byCenterPointRadiusNormal = Circle.ByCenterPointRadiusNormal(centerPoint=byCoordinates, radius=code_block.out2, normal=byCoordinates_2)
regularPolygon = Polygon.RegularPolygon(circle=byCenterPointRadiusNormal)
stringifyJSON = Data.StringifyJSON(values=regularPolygon)
parseJSON = Data.ParseJSON(json=stringifyJSON)
isAlmostEqualTo = Geometry.IsAlmostEqualTo(geometry=regularPolygon, other=parseJSON)
points = PolyCurve.Points(polyCurve=regularPolygon)
points_2 = PolyCurve.Points(polyCurve=parseJSON)
isAlmostEqualTo_2 = Geometry.IsAlmostEqualTo(geometry=points, other=points_2)
type = Object.Type(object=regularPolygon)
type_2 = Object.Type(object=parseJSON)
eq = type == type_2
reverse = Curve.Reverse(curve=regularPolygon)
points_3 = PolyCurve.Points(polyCurve=reverse)
stringifyJSON_2 = Data.StringifyJSON(values=reverse)
parseJSON_2 = Data.ParseJSON(json=stringifyJSON_2)
points_4 = PolyCurve.Points(polyCurve=parseJSON_2)
isAlmostEqualTo_3 = Geometry.IsAlmostEqualTo(geometry=points_3, other=points_4)
XZ = Plane.XZ()
mirror = Geometry.Mirror(geometry=regularPolygon, mirrorPlane=XZ)
points_5 = PolyCurve.Points(polyCurve=mirror)
stringifyJSON_3 = Data.StringifyJSON(values=mirror)
parseJSON_3 = Data.ParseJSON(json=stringifyJSON_3)
points_6 = PolyCurve.Points(polyCurve=parseJSON_3)
isAlmostEqualTo_4 = Geometry.IsAlmostEqualTo(geometry=points_5, other=points_6)
byOrigin = CoordinateSystem.ByOrigin()
code_block_2 = CodeBlock { 2; 3; 4; }
byOrigin_2 = CoordinateSystem.ByOrigin(x=code_block_2.out0, y=code_block_2.out1, z=code_block_2.out2)
byCoordinates_3 = Point.ByCoordinates()
byCoordinates_4 = Vector.ByCoordinates(x=code_block_2.out0, y=code_block_2.out2)
number = DoubleInput(24)
rotate = CoordinateSystem.Rotate(coordinateSystem=byOrigin_2, origin=byCoordinates_3, axis=byCoordinates_4, degrees=number)
number_2 = DoubleInput(2.3)
scale = CoordinateSystem.Scale(coordinateSystem=rotate, amount=number_2)
transform = Geometry.Transform(geometry=regularPolygon, fromCoordinateSystem=byOrigin, contextCoordinateSystem=scale)
points_7 = PolyCurve.Points(polyCurve=transform)
stringifyJSON_4 = Data.StringifyJSON(values=transform)
parseJSON_4 = Data.ParseJSON(json=stringifyJSON_4)
points_8 = PolyCurve.Points(polyCurve=parseJSON_4)
isAlmostEqualTo_5 = Geometry.IsAlmostEqualTo(geometry=points_7, other=points_8)
list_create = List.Create(item0=isAlmostEqualTo_2, item1=eq, item2=isAlmostEqualTo_3, item3=isAlmostEqualTo_4, item4=isAlmostEqualTo_5)
flatten = List.Flatten(list=list_create)

# group: All True
allTrue = List.AllTrue(list=flatten)
