# Dynamo graph Curve_Rectangle_JSONParsing.dyn (Dynamo 3.0.0.5795)

number = DoubleInput(2)
byCoordinates = Point.ByCoordinates(x=number, y=number, z=number)
code_block = CodeBlock { 1; 2.3; 4; }
byCoordinates_2 = Vector.ByCoordinates(x=code_block.out0, y=code_block.out1, z=code_block.out2)
byOriginNormal = Plane.ByOriginNormal(origin=byCoordinates, normal=byCoordinates_2)
code_block_2 = CodeBlock { 3; 4; }
byWidthLength = Rectangle.ByWidthLength(plane=byOriginNormal, width=code_block_2.out0, length=code_block_2.out1)
stringifyJSON = Data.StringifyJSON(values=byWidthLength)
parseJSON = Data.ParseJSON(json=stringifyJSON)
isAlmostEqualTo = Geometry.IsAlmostEqualTo(geometry=byWidthLength, other=parseJSON)
curves = PolyCurve.Curves(polyCurve=byWidthLength)
curves_2 = PolyCurve.Curves(polyCurve=parseJSON)
isAlmostEqualTo_2 = Geometry.IsAlmostEqualTo(geometry=curves, other=curves_2)
height = Rectangle.Height(rectangle=byWidthLength)
width = Rectangle.Width(rectangle=byWidthLength)
type = Object.Type(object=byWidthLength)
list_create = List.Create(item0=height, item1=width, item2=type)
height_2 = Rectangle.Height(rectangle=parseJSON)
width_2 = Rectangle.Width(rectangle=parseJSON)
type_2 = Object.Type(object=parseJSON)
list_create_2 = List.Create(item0=height_2, item1=width_2, item2=type_2)
eq = list_create == list_create_2
reverse = Curve.Reverse(curve=byWidthLength)
curves_3 = PolyCurve.Curves(polyCurve=reverse)
stringifyJSON_2 = Data.StringifyJSON(values=reverse)
parseJSON_2 = Data.ParseJSON(json=stringifyJSON_2)
curves_4 = PolyCurve.Curves(polyCurve=parseJSON_2)
isAlmostEqualTo_3 = Geometry.IsAlmostEqualTo(geometry=curves_3, other=curves_4)
height_3 = Rectangle.Height(rectangle=reverse)
width_3 = Rectangle.Width(rectangle=reverse)
list_create_3 = List.Create(item0=height_3, item1=width_3)
height_4 = Rectangle.Height(rectangle=parseJSON_2)
width_4 = Rectangle.Width(rectangle=parseJSON_2)
list_create_4 = List.Create(item0=height_4, item1=width_4)
eq_2 = list_create_3 == list_create_4
XZ = Plane.XZ()
mirror = Geometry.Mirror(geometry=byWidthLength, mirrorPlane=XZ)
curves_5 = PolyCurve.Curves(polyCurve=mirror)
stringifyJSON_3 = Data.StringifyJSON(values=mirror)
parseJSON_3 = Data.ParseJSON(json=stringifyJSON_3)
curves_6 = PolyCurve.Curves(polyCurve=parseJSON_3)
isAlmostEqualTo_4 = Geometry.IsAlmostEqualTo(geometry=curves_5, other=curves_6)
height_5 = Rectangle.Height(rectangle=mirror)
width_5 = Rectangle.Width(rectangle=mirror)
list_create_5 = List.Create(item0=height_5, item1=width_5)
height_6 = Rectangle.Height(rectangle=parseJSON_3)
width_6 = Rectangle.Width(rectangle=parseJSON_3)
list_create_6 = List.Create(item0=height_6, item1=width_6)
eq_3 = list_create_5 == list_create_6
byOrigin = CoordinateSystem.ByOrigin()
code_block_3 = CodeBlock { 2; 3; 4; }
byOrigin_2 = CoordinateSystem.ByOrigin(x=code_block_3.out0, y=code_block_3.out1, z=code_block_3.out2)
byCoordinates_3 = Point.ByCoordinates()
byCoordinates_4 = Vector.ByCoordinates(x=code_block_3.out0, y=code_block_3.out2)
number_2 = DoubleInput(24)
rotate = CoordinateSystem.Rotate(coordinateSystem=byOrigin_2, origin=byCoordinates_3, axis=byCoordinates_4, degrees=number_2)
number_3 = DoubleInput(2.3)
scale = CoordinateSystem.Scale(coordinateSystem=rotate, amount=number_3)
transform = Geometry.Transform(geometry=byWidthLength, fromCoordinateSystem=byOrigin, contextCoordinateSystem=scale)
curves_7 = PolyCurve.Curves(polyCurve=transform)
stringifyJSON_4 = Data.StringifyJSON(values=transform)
parseJSON_4 = Data.ParseJSON(json=stringifyJSON_4)
curves_8 = PolyCurve.Curves(polyCurve=parseJSON_4)
isAlmostEqualTo_5 = Geometry.IsAlmostEqualTo(geometry=curves_7, other=curves_8)
height_7 = Rectangle.Height(rectangle=transform)
width_7 = Rectangle.Width(rectangle=transform)
list_create_7 = List.Create(item0=height_7, item1=width_7)
height_8 = Rectangle.Height(rectangle=parseJSON_4)
width_8 = Rectangle.Width(rectangle=parseJSON_4)
list_create_8 = List.Create(item0=height_8, item1=width_8)
eq_4 = list_create_7 == list_create_8
list_create_9 = List.Create(item0=isAlmostEqualTo_2, item1=eq, item2=isAlmostEqualTo_3, item3=eq_2, item4=isAlmostEqualTo_4, item5=eq_3, item6=isAlmostEqualTo_5, item7=eq_4)

# group: All True
allTrue = List.AllTrue(list=list_create_9)
