# Dynamo graph JSON_Nodes_DesignScript.dyn (Dynamo 2.1.0.7026)

# group: DesignScript vs Nodes
code_block = CodeBlock { DSCore.Data.ParseJSON("{'thing':1}"); }
keys = DesignScript.Builtin.Dictionary.Keys(dictionary=code_block)
code_block_2 = CodeBlock { {"thing":1}; }
keys_2 = DesignScript.Builtin.Dictionary.Keys(dictionary=code_block_2)
eq = keys == keys_2
flatten = List.Flatten(list=eq)
values = DesignScript.Builtin.Dictionary.Values(dictionary=code_block)
values_2 = DesignScript.Builtin.Dictionary.Values(dictionary=code_block_2)
eq_2 = values == values_2
flatten_2 = List.Flatten(list=eq_2)
code_block_3 = CodeBlock(x=code_block_2) { DSCore.Data.StringifyJSON(x); }
stringifyJSON = Data.StringifyJSON(values=code_block_2)
eq_3 = code_block_3 == stringifyJSON
list_create = List.Create(item0=flatten, item1=flatten_2, item2=eq_3)

# group: Verify JSON DesignScript produces same results as nodes. 5df5ed6d-6270-4018-a479-4f7cefcf7fe8
allTrue = List.AllTrue(list=list_create)
