# Dynamo graph JSON_Nodes_PythonJSONParsing.dyn (Dynamo 2.1.0.7035)

# group: String to JSON
string = StringInput("""{"Lisa Rose": {"Lady in the Water": 2.5, "Snakes on a Plane": 3.5,
 "Just My Luck": 3.0, "Superman Returns": 3.5, "You, Me and Dupree": 2.5, 
 "The Night Listener": 3.0},
"Gene Seymour": {"Lady in the Water": 3.0, "Snakes on a Plane": 3.5, 
 "Just My Luck": 1.5, "Superman Returns": 5.0, "The Night Listener": 3.0, 
 "You, Me and Dupree": 3.5}, 
"Michael Phillips": {"Lady in the Water": 2.5, "Snakes on a Plane": 3.0,
 "Superman Returns": 3.5, "The Night Listener": 4.0},
"Claudia Puig": {"Snakes on a Plane": 3.5, "Just My Luck": 3.0,
 "The Night Listener": 4.5, "Superman Returns": 4.0, 
 "You, Me and Dupree": 2.5},
"Mick LaSalle": {"Lady in the Water": 3.0, "Snakes on a Plane": 4.0, 
 "Just My Luck": 2.0, "Superman Returns": 3.0, "The Night Listener": 3.0,
 "You, Me and Dupree": 2.0}, 
"Jack Matthews": {"Lady in the Water": 3.0, "Snakes on a Plane": 4.0,
 "The Night Listener": 3.0, "Superman Returns": 5.0, "You, Me and Dupree": 3.5},
"Toby": {"Snakes on a Plane":4.5,"You, Me and Dupree":1.0,"Superman Returns":4.0}}""")
parseJSON = Data.ParseJSON(json=string)

# group: Parse JSON String in Python
code_block = CodeBlock { "Lisa Rose"; }
python_script = Python(IN[0]=string, IN[1]=code_block)
# ---------- python_script.python (19 lines) ----------
import json

dataEnteringNode = IN
jsonString = IN[0]
user = IN[1]

jsonObject = json.loads(jsonString)
userData = jsonObject[user]

keys = []
values = []

for key in userData:
	keys.append(key)
	# String conversion required until
	# dictionary marshalling is handled
	values.append(userData[key])

OUT = [keys, values]
# ----------------------------------------
code_block_2 = CodeBlock(out=python_script) { keys = out[0]; values = out[1]; }

# group: Extract Keys/Value
sort = List.Sort(list=code_block_2.keys)
valueAtKey = DesignScript.Builtin.Dictionary.ValueAtKey(dictionary=parseJSON, key=code_block)
keys = DesignScript.Builtin.Dictionary.Keys(dictionary=valueAtKey)
sort_2 = List.Sort(list=keys)
eq = sort == sort_2
sort_3 = List.Sort(list=code_block_2.values)
values = DesignScript.Builtin.Dictionary.Values(dictionary=valueAtKey)
sort_4 = List.Sort(list=values)
eq_2 = sort_3 == sort_4

# group: Keys match when parsing JSON in Python e4e600d9-12a6-400e-adb3-02c1ad26cddf
allTrue = List.AllTrue(list=eq)

# group: Values match when parsing JSON in Python cdad5bf1-f5f7-47f4-a119-ad42e5084cfa
allTrue_2 = List.AllTrue(list=eq_2)
