# Dynamo graph JSON_Nodes_Replication.dyn (Dynamo 2.1.0.7026)

# group: Replication
code_block = CodeBlock { [1, 2, 3]; }
code_block_2 = CodeBlock(l1=code_block) { str1 = DSCore.Data.StringifyJSON(l1); }
watch = Watch(code_block_2)
stringifyJSON = Data.StringifyJSON(values=code_block)
watch_2 = Watch(stringifyJSON)
eq = watch == watch_2
code_block_3 = CodeBlock(l1=code_block) { str1 = DSCore.Data.StringifyJSON(l1<1>); }
watch_3 = Watch(code_block_3)
stringifyJSON_2 = Data.StringifyJSON(values=code_block@L1)
watch_4 = Watch(stringifyJSON_2)
eq_2 = watch_3 == watch_4
eq_3 = code_block_2 == code_block_3

# group: Compare DesignScript vs List@Level - no replication. e81d053f-dbc5-4b1e-86df-075c9b279aa3
allTrue = List.AllTrue(list=eq)

# group: Compare DesignScript vs List@Level - with replication. a0af3136-aaaf-40c2-b2ef-cee522f9ea45
allTrue_2 = List.AllTrue(list=eq_2)

# group: Verify replication produces different result. b69f2b6e-a328-43cf-a7a3-db42576ce814
allFalse = List.AllFalse(list=eq_3)
