# Dynamo graph JSON_Nodes_Test.dyn (Dynamo 4.0.0.2016)

# group: ParseJSON() 9dca6adc-dcf2-436a-9317-43a0af5195bc
PARSE_JSON = CodeBlock()
# ---------- PARSE_JSON.designscript (10 lines) ----------
[
	DSCore.Object.Type(DSCore.Data.ParseJSON("false")),
	DSCore.Object.Type(DSCore.Data.ParseJSON("[false]")[0]),
	DSCore.Object.Type(DSCore.Data.ParseJSON("{\"foo\": false}")),
	DSCore.Object.Type(DSCore.Data.ParseJSON("\"another test\"")),
	DSCore.Object.Type(DSCore.Data.ParseJSON("12")),
	DSCore.Object.Type(DSCore.Data.ParseJSON("\"2009-02-15T00:00:00Z\"")),
	DSCore.Object.Type(DSCore.Data.ParseJSON("1e10")),
	DSCore.Object.Type(DSCore.Data.ParseJSON("{\"foo\": [1,{},3]}"))
];
# ----------------------------------------

# group: StringifyJSON() 31f973f9-0764-47e1-b770-7b6b97d8803e
STRINGIFY_JSON = CodeBlock()
# ---------- STRINGIFY_JSON.designscript (10 lines) ----------
[
	DSCore.Object.Type(DSCore.Data.StringifyJSON({ "foo" : 5 })),
	DSCore.Object.Type(DSCore.Data.StringifyJSON(12)),
	DSCore.Object.Type(DSCore.Data.StringifyJSON([1,2,3])[0]),
	DSCore.Object.Type(DSCore.Data.StringifyJSON(Color.ByARGB())),
	DSCore.Object.Type(DSCore.Data.StringifyJSON("foo")),
	DSCore.Object.Type(DSCore.Data.StringifyJSON(null)),
	DSCore.Object.Type(DSCore.Data.StringifyJSON(false)),
	DSCore.Object.Type(DSCore.Data.StringifyJSON(DSCore.DateTime.Now))
];
# ----------------------------------------

# group: Compare JSON/Dictionary Key/Values
code_block = CodeBlock { ".\\JSONFile.json"; }
file_from_path = FileObject(path=code_block)
readText = FileSystem.ReadText(file=file_from_path)
parseJSON = Data.ParseJSON(json=readText)
keys = DesignScript.Builtin.Dictionary.Keys(dictionary=parseJSON)
valueAtKey = DesignScript.Builtin.Dictionary.ValueAtKey(dictionary=parseJSON, key=keys)
values = DesignScript.Builtin.Dictionary.Values(dictionary=valueAtKey)
dynamo_dictionary = CodeBlock()
# ---------- dynamo_dictionary.designscript (51 lines) ----------
{
	"Lisa Rose": {
		"Lady in the Water": 2.5,
		"Snakes on a Plane": 3.5,
 		"Just My Luck": 3.0,
 		"Superman Returns": 3.5,
 		"You, Me and Dupree": 2.5,
 		"The Night Listener": 3.0
 	},
	"Gene Seymour": {
		"Lady in the Water": 3.0,
		"Snakes on a Plane": 3.5,
 		"Just My Luck": 1.5,
 		"Superman Returns": 5.0,
 		"The Night Listener": 3.0,
 		"You, Me and Dupree": 3.5
 	},
	"Michael Phillips": {
		"Lady in the Water": 2.5,
		"Snakes on a Plane": 3.0,
 		"Superman Returns": 3.5,
 		"The Night Listener": 4.0
 	},
	"Claudia Puig": {
		"Snakes on a Plane": 3.5,
		"Just My Luck": 3.0,
 		"The Night Listener": 4.5,
 		"Superman Returns": 4.0,
 		"You, Me and Dupree": 2.5
 	},
	"Mick LaSalle": {
		"Lady in the Water": 3.0,
		"Snakes on a Plane": 4.0,
 		"Just My Luck": 2.0,
 		"Superman Returns": 3.0,
 		"The Night Listener": 3.0,
 		"You, Me and Dupree": 2.0
 	},
	"Jack Matthews": {
		"Lady in the Water": 3.0,
		"Snakes on a Plane": 4.0,
 		"The Night Listener": 3.0,
 		"Superman Returns": 5.0,
 		"You, Me and Dupree": 3.5
 	},
	"Toby": {
		"Snakes on a Plane":4.5,
		"You, Me and Dupree":1.0,
		"Superman Returns":4.0
	}
};
# ----------------------------------------
valueAtKey_2 = DesignScript.Builtin.Dictionary.ValueAtKey(dictionary=dynamo_dictionary, key=keys)
values_2 = DesignScript.Builtin.Dictionary.Values(dictionary=valueAtKey_2)
eq = values == values_2
flatten = List.Flatten(list=eq)
keys_2 = DesignScript.Builtin.Dictionary.Keys(dictionary=valueAtKey)
keys_3 = DesignScript.Builtin.Dictionary.Keys(dictionary=valueAtKey_2)
eq_2 = keys_2 == keys_3
flatten_2 = List.Flatten(list=eq_2)

# group: All Values Match 5b0b1aba-ee6b-420e-aa12-e54270c00718
allTrue = List.AllTrue(list=flatten)

# group: All Keys Match 5b0b1aba-ee6b-420e-aa12-e54270c00718
allTrue_2 = List.AllTrue(list=flatten_2)
