# Dynamo graph Solid_Cylinder_JSONParsing.dyn (Dynamo 3.0.0.5795)

code_block = CodeBlock { 2; 3.1; 4.3; }
byCoordinates = Point.ByCoordinates(x=code_block.out0, y=code_block.out1, z=code_block.out2)
code_block_2 = CodeBlock { -1; 5.6; 12; }
byCoordinates_2 = Point.ByCoordinates(x=code_block_2.out0, y=code_block_2.out1, z=code_block_2.out2)
number = DoubleInput(2.5)
byPointsRadius = Cylinder.ByPointsRadius(startPoint=byCoordinates, endPoint=byCoordinates_2, radius=number)
stringifyJSON = Data.StringifyJSON(values=byPointsRadius)
parseJSON = Data.ParseJSON(json=stringifyJSON)
isAlmostEqualTo = Geometry.IsAlmostEqualTo(geometry=byPointsRadius, other=parseJSON)
edges = Topology.Edges(topology=byPointsRadius)
firstItem = List.FirstItem(list=edges)
curveGeometry = Edge.CurveGeometry(edge=firstItem)
pointAtParameter = Curve.PointAtParameter(curve=curveGeometry)
edges_2 = Topology.Edges(topology=parseJSON)
firstItem_2 = List.FirstItem(list=edges_2)
curveGeometry_2 = Edge.CurveGeometry(edge=firstItem_2)
pointAtParameter_2 = Curve.PointAtParameter(curve=curveGeometry_2)
isAlmostEqualTo_2 = Geometry.IsAlmostEqualTo(geometry=pointAtParameter, other=pointAtParameter_2)
code_block_3 = CodeBlock { 2; 3; 4; }
byOrigin = CoordinateSystem.ByOrigin(x=code_block_3.out0, y=code_block_3.out1, z=code_block_3.out2)
byCoordinates_3 = Point.ByCoordinates()
byCoordinates_4 = Vector.ByCoordinates(x=code_block_3.out0, y=code_block_3.out2)
number_2 = DoubleInput(24)
rotate = CoordinateSystem.Rotate(coordinateSystem=byOrigin, origin=byCoordinates_3, axis=byCoordinates_4, degrees=number_2)
code_block_4 = CodeBlock { 2.5; 7; }
byRadiusHeight = Cylinder.ByRadiusHeight(coordinateSystem=rotate, radius=code_block_4.out0, height=code_block_4.out1)
stringifyJSON_2 = Data.StringifyJSON(values=byRadiusHeight)
parseJSON_2 = Data.ParseJSON(json=stringifyJSON_2)
isAlmostEqualTo_3 = Geometry.IsAlmostEqualTo(geometry=byRadiusHeight, other=parseJSON_2)
edges_3 = Topology.Edges(topology=parseJSON_2)
firstItem_3 = List.FirstItem(list=edges_3)
curveGeometry_3 = Edge.CurveGeometry(edge=firstItem_3)
pointAtParameter_3 = Curve.PointAtParameter(curve=curveGeometry_3)
edges_4 = Topology.Edges(topology=byRadiusHeight)
firstItem_4 = List.FirstItem(list=edges_4)
curveGeometry_4 = Edge.CurveGeometry(edge=firstItem_4)
pointAtParameter_4 = Curve.PointAtParameter(curve=curveGeometry_4)
isAlmostEqualTo_4 = Geometry.IsAlmostEqualTo(geometry=pointAtParameter_3, other=pointAtParameter_4)
XZ = Plane.XZ()
mirror = Geometry.Mirror(geometry=byPointsRadius, mirrorPlane=XZ)
stringifyJSON_3 = Data.StringifyJSON(values=mirror)
parseJSON_3 = Data.ParseJSON(json=stringifyJSON_3)
isAlmostEqualTo_5 = Geometry.IsAlmostEqualTo(geometry=mirror, other=parseJSON_3)
edges_5 = Topology.Edges(topology=parseJSON_3)
firstItem_5 = List.FirstItem(list=edges_5)
curveGeometry_5 = Edge.CurveGeometry(edge=firstItem_5)
pointAtParameter_5 = Curve.PointAtParameter(curve=curveGeometry_5)
edges_6 = Topology.Edges(topology=mirror)
firstItem_6 = List.FirstItem(list=edges_6)
curveGeometry_6 = Edge.CurveGeometry(edge=firstItem_6)
pointAtParameter_6 = Curve.PointAtParameter(curve=curveGeometry_6)
isAlmostEqualTo_6 = Geometry.IsAlmostEqualTo(geometry=pointAtParameter_5, other=pointAtParameter_6)
byOrigin_2 = CoordinateSystem.ByOrigin()
number_3 = DoubleInput(2.3)
scale = CoordinateSystem.Scale(coordinateSystem=rotate, amount=number_3)
transform = Geometry.Transform(geometry=byPointsRadius, fromCoordinateSystem=byOrigin_2, contextCoordinateSystem=scale)
stringifyJSON_4 = Data.StringifyJSON(values=transform)
parseJSON_4 = Data.ParseJSON(json=stringifyJSON_4)
isAlmostEqualTo_7 = Geometry.IsAlmostEqualTo(geometry=transform, other=parseJSON_4)
edges_7 = Topology.Edges(topology=parseJSON_4)
firstItem_7 = List.FirstItem(list=edges_7)
curveGeometry_7 = Edge.CurveGeometry(edge=firstItem_7)
pointAtParameter_7 = Curve.PointAtParameter(curve=curveGeometry_7)
edges_8 = Topology.Edges(topology=transform)
firstItem_8 = List.FirstItem(list=edges_8)
curveGeometry_8 = Edge.CurveGeometry(edge=firstItem_8)
pointAtParameter_8 = Curve.PointAtParameter(curve=curveGeometry_8)
isAlmostEqualTo_8 = Geometry.IsAlmostEqualTo(geometry=pointAtParameter_7, other=pointAtParameter_8)
type = Object.Type(object=byPointsRadius)
type_2 = Object.Type(object=parseJSON)
eq = type == type_2
list_create = List.Create(item0=isAlmostEqualTo, item1=isAlmostEqualTo_2, item2=isAlmostEqualTo_3, item3=isAlmostEqualTo_4, item4=isAlmostEqualTo_5, item5=isAlmostEqualTo_6, item6=isAlmostEqualTo_7, item7=isAlmostEqualTo_8, item8=eq)

# group: All True For Cylinder
allTrue = List.AllTrue(list=list_create)
