# Dynamo graph DisplayReturn.dyn (Dynamo 1.0.0.832)

code_block = CodeBlock()
# ---------- code_block.designscript (7 lines) ----------
def BlueSphere()
{
point1 = Autodesk.Point.ByCoordinates(40, 0, 0);
sphere1 = Sphere.ByCenterPointRadius(point1, 8);
color1 = DSCore.Color.ByARGB(255, 0, 0, 255);
return = GeometryColor.ByGeometryColor(sphere1, color1);
};
# ----------------------------------------
code_block_2 = CodeBlock { BlueSphere(); }
watch = Watch(code_block_2)
code_block_3 = CodeBlock()
# ---------- code_block_3.designscript (6 lines) ----------
def RedPoints()
{
points = Autodesk.Point.ByCoordinates(1..5, 0, 0);
color1 = DSCore.Color.ByARGB(255, 255, 0, 0);
return = GeometryColor.ByGeometryColor(points, color1);
};
# ----------------------------------------
code_block_4 = CodeBlock { RedPoints(); }
watch_2 = Watch(code_block_4)
