# Dynamo graph IEnumerableOfDifferentObjectType.dyn (Dynamo 0.7.1.22674)

dummyClassA = FFITarget.DummyClassA.DummyClassA()
IEnumerableOfDifferentObjectType = FFITarget.OverloadTarget.IEnumerableOfDifferentObjectType(dummyClassA)
code_block = CodeBlock(r1=IEnumerableOfDifferentObjectType) { r1; }
dummyClassB = FFITarget.DummyClassB.DummyClassB()
IEnumerableOfDifferentObjectType_2 = FFITarget.OverloadTarget.IEnumerableOfDifferentObjectType(dummyClassB)
code_block_2 = CodeBlock(r2=IEnumerableOfDifferentObjectType_2) { r2; }
