# Dynamo graph PrimitiveType.dyn (Dynamo 0.7.1.22674)

code_block = CodeBlock { true; }
differentPrimitiveType = FFITarget.OverloadTarget.DifferentPrimitiveType(code_block)
code_block_2 = CodeBlock(r1=differentPrimitiveType) { r1; }
code_block_3 = CodeBlock { 1; }
differentPrimitiveType_2 = FFITarget.OverloadTarget.DifferentPrimitiveType(code_block_3)
code_block_4 = CodeBlock(r2=differentPrimitiveType_2) { r2; }
