# Dynamo graph converterNodeTest.dyn "converter_node_test" (Dynamo 2.9.0.2856)

number = DoubleInput(34)
convert_between_units = DynamoConvert(number, MeasurementType="Length", FromConversion="Inches", ToConversion="Meters")
watch = Watch(convert_between_units)
