# Dynamo graph AddToList_Complex.dyn (Dynamo 1.0.1.1743)

number = DoubleInput(0..10)
string = StringInput("Dynamo")
create_list = List.Create(number, string)
code_block = CodeBlock { {3}; }
number_2 = DoubleInput(3)
sublists = List.Sublists(list=number, ranges=code_block, offset=number_2)
watch = Watch(sublists)
deconstruct = List.Deconstruct(list=sublists)
watch_2 = Watch(deconstruct.first)
watch_3 = Watch(deconstruct.rest)
addItemToFront = List.AddItemToFront(item=watch_2, list=watch_3)
watch_4 = Watch(addItemToFront)
