# Dynamo graph AddToList_ContainingNull.dyn (Dynamo 1.0.1.1743)

code_block = CodeBlock { 2; }
code_block_2 = CodeBlock { {3,4,null,6}; }
addItemToFront = List.AddItemToFront(item=code_block, list=code_block_2)
watch = Watch(addItemToFront)
