# Dynamo graph AddToList_EmptyList.dyn (Dynamo 1.0.1.1743)

string = StringInput("")
number = DoubleInput(0)
create_list = List.Create(string, number)
empty = List.Empty()
addItemToFront = List.AddItemToFront(item=create_list, list=empty)
watch = Watch(addItemToFront)
