# Dynamo graph AddToList_GeometryToList.dyn (Dynamo 1.0.1.1743)

number = DoubleInput(10)
point = Point3DNode(number, lacing=Longest)
string = StringInput("Dynamo")
number_2 = DoubleInput(-10..-1..3)
string_2 = StringInput("Design")
string_3 = StringInput("Script")
create_list = List.Create(string, number_2, string_2, string_3, number)
addItemToFront = List.AddItemToFront(item=point, list=create_list)
watch = Watch(addItemToFront)
