# Dynamo graph AddToList_Negative.dyn (Dynamo 1.0.1.1743)

empty = List.Empty()
string = StringInput("")
number = DoubleInput(0)
create_list = List.Create(string, number)
addItemToFront = List.AddItemToFront(item=empty, list=create_list)
watch = Watch(addItemToFront)
