# Dynamo graph AddToList_SimpleTest.dyn (Dynamo 1.0.1.1743)

string = StringInput("Design")
string_2 = StringInput("Dynamo")
number = DoubleInput(-10..-1..3)
string_3 = StringInput("Script")
number_2 = DoubleInput(10)
create_list = List.Create(string_2, number, string, string_3, number_2)
addItemToFront = List.AddItemToFront(item=string, list=create_list)
watch = Watch(addItemToFront)
