# Dynamo graph AllIndicesOf.dyn (Dynamo 0.8.1.1181)

code_block = CodeBlock { {"foo", "bar", "foo"}; }
code_block_2 = CodeBlock { "foo"; }
allIndicesOf = List.AllIndicesOf(list=code_block, item=code_block_2)
