# Dynamo graph AnyFalse_SimpleTest.dyn "DYN-2352 List.AnyFalse" (Dynamo 2.10.0.3244)

code_block = CodeBlock()
# ---------- code_block.designscript (5 lines) ----------
a = [true];
b = [false,false,[false,[false,[false,false,[false],false]]],false];
c = [true,true,true,true,[true,true],true,[true,true,[true, true,[true],true,true,true]]];
j = [false,false,[false,[false,[true,false,[false],false]]],false];
k = [true,true,true,true,[true,true],true,[true,true,[true, true,[false],true,true,true]]];
# ----------------------------------------
anyFalse = List.AnyFalse(list=code_block.c)
anyFalse_2 = List.AnyFalse(list=code_block.j)
anyFalse_3 = List.AnyFalse(list=code_block.a)
anyFalse_4 = List.AnyFalse(list=code_block.b)
anyFalse_5 = List.AnyFalse(list=code_block.k)
