# Dynamo graph AnyTrue_SimpleTest.dyn "DYN-2352 List.AnyTrue" (Dynamo 2.10.0.3244)

code_block = CodeBlock()
# ---------- code_block.designscript (6 lines) ----------
a = [true];
b = [false,false,[false,[false,[false,false,[false],false]]],false];
c = [true,true,true,true,[true,true],true,[true,true,[true, true,[true],true,true,true]]];

j = [false,false,[false,[false,[true,false,[false],false]]],false];
k = [true,true,true,true,[true,true],true,[true,true,[true, true,[false],true,true,true]]];
# ----------------------------------------
anyTrue = List.AnyTrue(list=code_block.a)
anyTrue_2 = List.AnyTrue(list=code_block.b)
anyTrue_3 = List.AnyTrue(list=code_block.c)
anyTrue_4 = List.AnyTrue(list=code_block.j)
anyTrue_5 = List.AnyTrue(list=code_block.k)
