# Dynamo graph Average_NegativeInputTest.dyn (Dynamo 0.6.3.5265)

number = DoubleInput(5)
number_2 = DoubleInput(8)
string = StringInput("Dynamo")
list = NewList(index0=number, index1=number_2, index2=number, index3=string)
average = Average(list, lacing=Longest)
