# Dynamo graph Average_SimpleTest.dyn (Dynamo 0.6.3.5265)

number = DoubleInput(5)
number_2 = DoubleInput(8)
list = NewList(index0=number, index1=number_2, index2=number)
average = Average(list, lacing=Longest)
