# Dynamo graph CartesianProduct_ListNumberSequence.dyn

add = Addition(lacing=Longest)
number = DoubleInput(0)
number_2 = DoubleInput(3)
list = NewList(index0=number, index1=number_2)
number_3 = DoubleInput(1)
number_4 = DoubleInput(2)
number_5 = DoubleInput(3)
number_sequence = NumberSeq(number_3, number_4, number_5, lacing=Longest)
cartesian_product = CartProd(add, list, number_sequence)
watch = Watch(cartesian_product)
