# Dynamo graph CombineNode_EdgeCase.dyn

add = Addition(lacing=Longest)
number = DoubleInput(1387654679874)
list = NewList(index0=number)
number_2 = DoubleInput(849635489762158798)
list_2 = NewList(index0=number_2)
combine = Combine(add, list, list_2)
