# Dynamo graph Combine_ComplexTest.dyn (Dynamo 1.0.1.1743)

string = StringInput("""x,y,z,x,y,z,x,y,z,x,y,z
6450,3250,36242.5,6450,3250,40142.5,7950,3250,40142.5,7950,3250,36242.5
10950,-1250,16742.5,10950,-1250,20642.5,12450,-1250,20642.5,12450,-1250,16742.5""")
string_2 = StringInput("\n")
split = String.Split(string, string_2)
string_3 = StringInput(",")
split_2 = String.Split(arg1=string_3)
map = List.Map(list=split, f_x=split_2)
number = DoubleInput(0)
getItemAtIndex = List.GetItemAtIndex(list=map, index=number)
removeItemAtIndex = List.RemoveItemAtIndex(list=map, indices=number)
toNumber = String.ToNumber(lacing=Longest)
map_2 = List.Map(list=removeItemAtIndex, f_x=toNumber)
number_2 = DoubleInput(0.003)
mul = _ * number_2  # lacing=Longest
map_3 = List.Map(list=map_2, f_x=mul)
addItemToFront = List.AddItemToFront(item=getItemAtIndex, list=map_3)
number_3 = DoubleInput(1)
getItemAtIndex_2 = List.GetItemAtIndex(list=addItemToFront, index=number_3)
number_4 = DoubleInput(3)
shiftIndices = List.ShiftIndices(list=getItemAtIndex_2, amount=number_4)
watch = Watch(shiftIndices)
removeItemAtIndex_2 = List.RemoveItemAtIndex(list=addItemToFront, indices=number_3)
watch_2 = Watch(removeItemAtIndex_2)
add = _ + _  # lacing=Longest
number_5 = DoubleInput(2)
getItemAtIndex_3 = List.GetItemAtIndex(list=addItemToFront, index=number_5)
combine = List.Combine(add, getItemAtIndex_3, shiftIndices)
