# Dynamo graph Combine_SimpleTest.dyn (Dynamo 1.0.1.1743)

div = _ / _  # lacing=Longest
number = DoubleInput(20..200..#20)
number_2 = DoubleInput(5..24)
combine = List.Combine(div, number, number_2)
