# Dynamo graph DSCore_LaceLongest.dyn (Dynamo 0.8.1.1314)

add = _ + _  # lacing=Longest
number = DoubleInput(1..10)
number_2 = DoubleInput(1..20)
longest = LaceLongest(add, number, number_2)  # "List.Longest"
