# Dynamo graph DropEveryNth_InputEmptyList.dyn (Dynamo 1.0.1.1743)

empty = List.Empty()
number = DoubleInput(1)
number_2 = DoubleInput(1)
dropEveryNthItem = List.DropEveryNthItem(list=empty, n=number, offset=number_2)
watch = Watch(dropEveryNthItem)
