# Dynamo graph DropEveryNth_InputStringForNth.dyn (Dynamo 1.0.1.1743)

number = DoubleInput(1..10)
string = StringInput("Dynamo")
number_2 = DoubleInput(2)
dropEveryNthItem = List.DropEveryNthItem(list=number, n=string, offset=number_2)
