# Dynamo graph DropEveryNth_SimpleTest.dyn (Dynamo 1.0.1.1743)

number = DoubleInput(1..10)
number_2 = DoubleInput(5)
dropEveryNthItem = List.DropEveryNthItem(list=number, n=number_2, offset=number_2)
watch = Watch(dropEveryNthItem)
