# Dynamo graph DropFromList_SimpleTest.dyn (Dynamo 1.0.1.1743)

number = DoubleInput(0..10)
number_2 = DoubleInput(-5)
dropItems = List.DropItems(list=number, amount=number_2)
watch = Watch(dropItems)
number_3 = DoubleInput(5)
dropItems_2 = List.DropItems(list=number, amount=number_3)
watch_2 = Watch(dropItems_2)
