# Dynamo graph FilterOut_Complex.dyn (Dynamo 1.0.1.1743)

number = DoubleInput(1..10)
number_2 = DoubleInput(3)
lessThan = Compare.LessThan(arg1=number_2)
filter = Filter(number, lessThan)
takeItems = List.TakeItems(list=filter.out1, amount=number_2)
watch = Watch(takeItems)
greaterThan = Compare.GreaterThan(arg1=number_2)
filter_2 = Filter(number, greaterThan)
dropItems = List.DropItems(list=filter_2.out1, amount=number_2)
watch_2 = Watch(dropItems)
addItemToFront = List.AddItemToFront(item=number_2, list=filter.out1)
