# Dynamo graph FilterOut_NegativeTest.dyn (Dynamo 1.0.1.1743)

number = DoubleInput(1..100)
number_2 = DoubleInput(25..50)
greaterThan = Compare.GreaterThan(arg1=number_2)
filter = Filter(number, greaterThan)
