# Dynamo graph FilterOut_NegativeTest2.dyn (Dynamo 0.7.0.20803)

code_block = CodeBlock { 1..100; }
code_block_2 = CodeBlock { "abc"; }
greaterThan = Compare.GreaterThan(arg1=code_block_2)
filter = Filter(code_block, greaterThan)
watch = Watch(filter.out0)
watch_2 = Watch(filter.out1)
