# Dynamo graph FilterOut_SimpleTest.dyn (Dynamo 1.0.1.1743)

number = DoubleInput(1..10)
number_2 = DoubleInput(3)
lessThan = Compare.LessThan(arg1=number_2)
filter = Filter(number, lessThan)
watch = Watch(filter.out1)
greaterThan = Compare.GreaterThan(arg1=number_2)
filter_2 = Filter(number, greaterThan)
watch_2 = Watch(filter_2.out1)
