# Dynamo graph Filter_Complex.dyn (Dynamo 1.0.1.1743)

number = DoubleInput(0..10)
number_2 = DoubleInput(5)
greaterThan = Compare.GreaterThan(arg1=number_2)
filter = Filter(number, greaterThan)
watch = Watch(filter)
lessThan = Compare.LessThan(arg1=number_2)
filter_2 = Filter(number, lessThan)
watch_2 = Watch(filter_2)
div = _ / _  # lacing=Longest
combine = List.Combine(div, filter, filter_2)
watch_3 = Watch(combine)
