# Dynamo graph Filter_SimpleTest.dyn (Dynamo 1.0.1.1743)

number = DoubleInput(0)
number_2 = DoubleInput(10)
number_3 = DoubleInput(1)
range = Range(start=number, end=number_2, step=number_3)
number_4 = DoubleInput(5)
greaterThan = Compare.GreaterThan(arg1=number_4)
filter = Filter(range, greaterThan)
watch = Watch(filter)
watch_2 = Watch(range)
