# Dynamo graph FirstIndexOf.dyn (Dynamo 0.8.1.1181)

code_block = CodeBlock { {"foo", "bar"}; }
code_block_2 = CodeBlock { "foo"; }
firstIndexOf = List.FirstIndexOf(list=code_block, item=code_block_2)
