# Dynamo graph GetFromList_AmtAsRangeExpn.dyn (Dynamo 0.7.0.18121)

code_block = CodeBlock { 0; }
number_slider = DoubleSlider(15, range=0..50)
code_block_2 = CodeBlock { 1; }
code_block_3 = CodeBlock(start0=code_block, amount1=number_slider, step2=code_block_2) { start0.. amount1*step2-step2+start0..step2; }
code_block_4 = CodeBlock { 2..5; }
concat = Concat(code_block_3, code_block_4)
code_block_5 = CodeBlock { 14..16; }
getItemAtIndex = List.GetItemAtIndex(concat, code_block_5)
watch = Watch(getItemAtIndex)
