# Dynamo graph GetFromList_InputEmptyList.dyn (Dynamo 1.0.1.1743)

empty = List.Empty()
number = DoubleInput(1)
getItemAtIndex = List.GetItemAtIndex(list=empty, index=number)
watch = Watch(getItemAtIndex)
