# Dynamo graph GetFromList_Negative.dyn (Dynamo 1.0.1.1743)

number = DoubleInput(0)
number_slider = DoubleSlider(9.724220624, range=0..50 step 0.1)
number_2 = DoubleInput(1)
range = Range(start=number, end=number_slider, step=number_2, lacing=Longest)
code_block = CodeBlock { {3}; }
number_3 = DoubleInput(3)
sublists = List.Sublists(list=range, ranges=code_block, offset=number_3)
number_4 = DoubleInput(5)
getItemAtIndex = List.GetItemAtIndex(list=sublists, index=number_4)
watch = Watch(getItemAtIndex)
