# Dynamo graph JoinList_MoreLists.dyn (Dynamo 1.0.1.1743)

number = DoubleInput(10..100..#5)
string = StringInput("Dynamo")
number_2 = DoubleInput(10)
create_list = List.Create(string, number_2)
string_2 = StringInput("DS")
number_3 = DoubleInput(10)
number_4 = DoubleInput(0.256)
create_list_2 = List.Create(string_2, number_3, number_4)
create_list_3 = List.Create(create_list, create_list_2)
join = List.Join(number, create_list_3)
watch = Watch(number)
