# Dynamo graph JoinList_SimpleTest.dyn (Dynamo 0.6.3.5265)

number = DoubleInput(10..100..#5)
string = StringInput("Dynamo")
number_2 = DoubleInput(10)
list = NewList(index0=string, index1=number_2)
join_lists = Append(number, list)
watch = Watch(number)
