# Dynamo graph LaceCartesian_Simple.dyn (Dynamo 2.1.0.7451)

add = _ + _  # unwired: x, y
code_block = CodeBlock { 1..3; }
cartesianProduct = List.CartesianProduct(comb=add, list1=code_block, list2=code_block)
add_2 = code_block + code_block  # lacing=CrossProduct
