# Dynamo graph LaceLongest_Simple.dyn (Dynamo 1.0.1.1743)

add = _ + _  # lacing=Longest
number = DoubleInput(1..10)
number_2 = DoubleInput(-1..10)
longest = LaceLongest(add, number, number_2)  # "List.Longest"
code_block = CodeBlock { {1}; }
number_3 = DoubleInput(3)
sublists = List.Sublists(list=longest, ranges=code_block, offset=number_3)
watch = Watch(sublists)
watch_2 = Watch(longest)
