# Dynamo graph LaceShortest_NegativeInput.dyn (Dynamo 1.0.1.1743)

and_ = And()
string = StringInput("Dynamo")
string_2 = StringInput("Design")
string_3 = StringInput("Script")
create_list = List.Create(string, string_2, string_3)
number = DoubleInput(1..3)
number_2 = DoubleInput(2..4)
number_3 = DoubleInput(9..10)
laceShortest = List.LaceShortest(and_, create_list, number, create_list, number_2, number, create_list, number_3, number)
