# Dynamo graph LaceShortest_Simple.dyn (Dynamo 1.0.1.1743)

add = _ + _  # lacing=Longest
number = DoubleInput(1..5)
number_2 = DoubleInput(1..2)
laceShortest = List.LaceShortest(add, number, number_2)
reverse = List.Reverse(laceShortest)
watch = Watch(reverse)
div = _ / _  # lacing=Longest
sub = _ - _  # lacing=Longest
number_3 = DoubleInput(1..5)
number_4 = DoubleInput(5..6)
laceShortest_2 = List.LaceShortest(sub, number_3, number_4)
combine = List.Combine(div, laceShortest, laceShortest_2)
watch_2 = Watch(combine)
