# Dynamo graph LaceShortest_WithSingleValueInput.dyn (Dynamo 0.7.0.32281)

code_block = CodeBlock { 1..2; }
code_block_2 = CodeBlock { {1}; }
add = code_block + code_block_2
code_block_3 = CodeBlock { 1; }
add_2 = code_block + code_block_3
