# Dynamo graph ListJoin.dyn (Dynamo 0.8.2.1957)

code_block = CodeBlock { 5; }
byCoordinates = Point.ByCoordinates(x=code_block)
code_block_2 = CodeBlock { {1,2,3}; }
join = List.Join(byCoordinates, code_block_2)
firstItem = List.FirstItem(join)
X = Point.X(firstItem)
