# Dynamo graph ListMaximumItem.dyn (Dynamo 2.1.0.5686)

code_block = CodeBlock { [12.5,3]; }
code_block_2 = CodeBlock(x=code_block) { List.MaximumItem(x); }
minimumItem = List.MinimumItem(list=code_block)
code_block_3 = CodeBlock { ["12.5", "3"]; }
code_block_4 = CodeBlock(x=code_block_3) { String.ToNumber(x); }
minimumItem_2 = List.MinimumItem(list=code_block_4)
code_block_5 = CodeBlock(x=code_block_4) { List.MaximumItem(x); }
