# Dynamo graph ListMaximumMinimum_WithAndWithoutKey.dyn (Dynamo 1.0.1.1743)

string = StringInput("aaa")
string_2 = StringInput("b")
string_3 = StringInput("ccccc")
string_4 = StringInput("dd")
string_5 = StringInput("eeee")
create_list = List.Create(string, string_2, string_3, string_4, string_5)
maximumItem = List.MaximumItem(create_list)
watch = Watch(maximumItem)
minimumItem = List.MinimumItem(create_list)
watch_2 = Watch(minimumItem)
length = String.Length()
maximumItemByKey = MaximumItemByKey(create_list, length)
watch_3 = Watch(maximumItemByKey)
minimumItemByKey = MinimumItemByKey(create_list, length)
watch_4 = Watch(minimumItemByKey)
