# Dynamo graph ListMinimum_Complex.dyn (Dynamo 1.0.1.1743)

number = DoubleInput(-1)
number_slider = DoubleSlider(9.249743063, range=0..10 step 0.1)
number_2 = DoubleInput(1)
range = Range(start=number, end=number_slider, step=number_2, lacing=Longest)
number_3 = DoubleInput(5)
lessThan = Compare.LessThan(arg1=number_3)
filter = Filter(range, lessThan)
greaterThan = Compare.GreaterThan(arg1=number_3)
minimumItemByKey = MinimumItemByKey(filter.out1, greaterThan)
watch = Watch(minimumItemByKey)
watch_2 = Watch(filter.out1)
