# Dynamo graph ListSortByKey.dyn (Dynamo 2.10.0.3156)

code_block = CodeBlock()
# ---------- code_block.designscript (4 lines) ----------
["Zack",
        "Ian",
        "Neal",
        "Anna"];
# ----------------------------------------
code_block_2 = CodeBlock()
# ---------- code_block_2.designscript (3 lines) ----------
[-3,
        1.6,
        "abc",5];
# ----------------------------------------
sortByKey = List.SortByKey(list=code_block, keys=code_block_2)
watch = Watch(sortByKey.sortedKeys)
watch_2 = Watch(sortByKey.sortedList)
