# Dynamo graph List_Map_DefaultArg5233.dyn (Dynamo 0.7.5.3346)

code_block = CodeBlock { 0..10..1; }
byCoordinates = Point.ByCoordinates(code_block)
translate = Geometry.Translate()
map = List.Map(byCoordinates, translate)
X = Point.X(map)
