# Dynamo graph Listmap.dyn (Dynamo 0.8.1.910)

code_block = CodeBlock { {{{1,2},{3,4}},{{10,20},{30,40}}}; }
byCoordinates = Point.ByCoordinates(x=code_block, y=code_block, z=code_block)
flatten = Flatten()
map = List.Map(list=byCoordinates, f_x=flatten)
X = Point.X(map)
Y = Point.Y(map)
Z = Point.Z(map)
