# Dynamo graph MappingTest.dyn

refPointFromXYZ = Custom[RefPointFromXYZ]()
number = DoubleInput(0)
number_2 = DoubleInput(1)
number_3 = DoubleInput(2)
number_4 = DoubleInput(3)
list = NewList(index0=number, index1=number_2, index2=number_3, index3=number_4)
map = Map(refPointFromXYZ, list)
