# Dynamo graph NumberRange_Complex.dyn (Dynamo 1.0.1.1743)

number = DoubleInput(0)
number_2 = DoubleInput(1000000)
number_3 = DoubleInput(1)
range = Range(start=number, end=number_2, step=number_3, lacing=Longest)
count = List.Count(range)
