# Dynamo graph NumberRange_LacingCrossProduct.dyn (Dynamo 1.0.1.1743)

number = DoubleInput(1..2)
number_2 = DoubleInput(10)
number_3 = DoubleInput(1..2)
range = Range(start=number, end=number_2, step=number_3, lacing=CrossProduct)
count = List.Count(range)
watch = Watch(range)
