# Dynamo graph NumberRange_LacingShortest.dyn (Dynamo 0.7.0.18121)

code_block = CodeBlock { 1..2; }
code_block_2 = CodeBlock { 10; }
code_block_3 = CodeBlock { 1..2; }
code_block_4 = CodeBlock(start0=code_block, end1=code_block_2, step2=code_block_3) { start0..end1..step2; }
count = List.Count(code_block_4)
watch = Watch(code_block_4)
code_block_5 = CodeBlock(a=code_block_4) { a[0]; }
code_block_6 = CodeBlock(a=code_block_4) { a[1]; }
