# Dynamo graph NumberRange_LargeNumber.dyn

number = DoubleInput(0)
number_2 = DoubleInput(1000000)
number_3 = DoubleInput(1)
number_range = NumberRange(number, number_2, number_3, lacing=Longest)
list_length = Length(number_range)
