# Dynamo graph NumberRange_SimpleTest.dyn (Dynamo 1.0.1.1743)

number = DoubleInput(0)
number_slider = DoubleSlider(50, range=0..100 step 0.1)
number_2 = DoubleInput(1)
range = Range(start=number, end=number_slider, step=number_2, lacing=Longest)
count = List.Count(range)
