# Dynamo graph RemoveFromList_Complex.dyn (Dynamo 0.7.0.35153)

number = DoubleInput(5)
formula = Formula("10-5", lacing=Longest)
number_2 = DoubleInput(1)
number_3 = DoubleInput(1..10)
shift_list_indeces = ShiftList(number_2, number_3)
slice_list = SliceList(number, formula, shift_list_indeces)
watch = Watch(slice_list)
formula_2 = Formula("1*2", lacing=Longest)
number_4 = DoubleInput(2..4)
get_from_list = GetFromList(number_4, slice_list)
remove_from_list = RemoveFromList(formula_2, get_from_list)
watch_2 = Watch(remove_from_list)
watch_3 = Watch(shift_list_indeces)
