# Dynamo graph RemoveFromList_RangeExpnAsIndex.dyn (Dynamo 1.0.1.1743)

number = DoubleInput(1..10)
number_2 = DoubleInput(1)
shiftIndices = List.ShiftIndices(list=number, amount=number_2)
watch = Watch(shiftIndices)
number_3 = DoubleInput(0..9)
removeItemAtIndex = List.RemoveItemAtIndex(list=shiftIndices, indices=number_3)
watch_2 = Watch(removeItemAtIndex)
number_4 = DoubleInput(2..6)
removeItemAtIndex_2 = List.RemoveItemAtIndex(list=shiftIndices, indices=number_4)
watch_3 = Watch(removeItemAtIndex_2)
