# Dynamo graph RemoveFromList_SimpleTest.dyn (Dynamo 1.0.1.1743)

string = StringInput("testRemoveFromList")
number = DoubleInput(98.1564)
string_2 = StringInput("Dynamo")
number_2 = DoubleInput(10.689)
string_3 = StringInput("Design")
string_4 = StringInput("Script")
create_list = List.Create(string, number, string_2, number_2, string_3, string_4)
number_3 = DoubleInput(1)
removeItemAtIndex = List.RemoveItemAtIndex(list=create_list, indices=number_3)
watch = Watch(removeItemAtIndex)
