# Dynamo graph ReplicationForMinMaxSort.dyn (Dynamo 0.7.1.29160)

code_block = CodeBlock { {1..10, 5..10}; }
shuffle = List.Shuffle()
map = List.Map(code_block, shuffle)
maximumItem = List.MaximumItem(map)
minimumItem = List.MinimumItem(map)
sort = List.Sort(map)
maximumItem_2 = List.MaximumItem()
list_map_max = Map(map, maximumItem_2)
minimumItem_2 = List.MinimumItem()
list_map_min = Map(map, minimumItem_2)
sort_2 = List.Sort()
list_map_sort = Map(map, sort_2)
