# Dynamo graph Reverse_NumberRange.dyn (Dynamo 1.0.1.1743)

number = DoubleInput(-1)
number_slider = DoubleSlider(6.875642343, range=0..10 step 0.1)
number_2 = DoubleInput(1)
range = Range(start=number, end=number_slider, step=number_2, lacing=Longest)
reverse = List.Reverse(range)
watch = Watch(reverse)
watch_2 = Watch(range)
