# Dynamo graph Reverse_UsingStringList.dyn (Dynamo 1.0.1.1743)

string = StringInput("Dynamo")
string_2 = StringInput("magneto")
string_3 = StringInput("Design")
string_4 = StringInput("Script")
create_list = List.Create(string, string_2, string_3, string_4)
reverse = List.Reverse(create_list)
watch = Watch(reverse)
watch_2 = Watch(create_list)
