# Dynamo graph Reverse_WithArrayInput.dyn (Dynamo 1.0.1.1743)

number = DoubleInput(0)
number_2 = DoubleInput(10)
number_3 = DoubleInput(1)
range = Range(start=number, end=number_2, step=number_3, lacing=Longest)
number_4 = DoubleInput(1)
number_5 = DoubleInput(10)
number_6 = DoubleInput(2)
range_2 = Range(start=number_4, end=number_5, step=number_6, lacing=Longest)
number_7 = DoubleInput(2)
number_8 = DoubleInput(10)
number_9 = DoubleInput(3)
range_3 = Range(start=number_7, end=number_8, step=number_9, lacing=Longest)
create_list = List.Create(range, range_2, range_3)
watch = Watch(create_list)
reverse = List.Reverse(create_list)
watch_2 = Watch(reverse)
