# Dynamo graph Reverse_WithSingleInput.dyn (Dynamo 1.0.1.1743)

number = DoubleInput(10)
number_2 = DoubleInput(2)
number_3 = DoubleInput(3)
create_list = List.Create(number, number_2, number_3)
watch = Watch(create_list)
reverse = List.Reverse(create_list)
watch_2 = Watch(reverse)
