# Dynamo graph ShiftListIndeces_InputEmptyList.dyn (Dynamo 1.0.1.1743)

empty = List.Empty()
number = DoubleInput(4)
shiftIndices = List.ShiftIndices(list=empty, amount=number)
watch = Watch(shiftIndices)
