# Dynamo graph ShiftListIndeces_InputStringAsAmt.dyn (Dynamo 1.0.1.1743)

number = DoubleInput(1..10)
string = StringInput("Dynamo")
shiftIndices = List.ShiftIndices(list=number, amount=string)
watch = Watch(shiftIndices)
