# Dynamo graph ShiftListIndeces_MultipleInput.dyn (Dynamo 1.0.1.1743)

number = DoubleInput(1..10)
number_2 = DoubleInput(1..4)
shiftIndices = List.ShiftIndices(list=number, amount=number_2)
watch = Watch(shiftIndices)
