# Dynamo graph SliceList_Complex.dyn (Dynamo 0.7.0.25915)

number = DoubleInput(3)
string = StringInput("Dynamo")
number_2 = DoubleInput(4.5)
string_2 = StringInput("Design")
string_3 = StringInput("Script")
number_slider = DoubleSliderInput(50, range=0..100)
add = Addition(number_slider, number_2, lacing=Longest)
list = NewList(index0=string, index1=number_2, index2=string_2, index3=string_3, index4=number_slider, index5=add)
reverse = Reverse(list)
slice_list = SliceList(number, number, reverse)
number_3 = DoubleInput(0..5..2)
