# Dynamo graph SliceList_MultipleInput.dyn (Dynamo 1.0.1.1743)

string = StringInput("Dynamo")
number = DoubleInput(4.5)
string_2 = StringInput("Design")
string_3 = StringInput("Script")
number_slider = DoubleSlider(50, range=0..100 step 0.1)
add = number_slider + number  # lacing=Longest
create_list = List.Create(string, number, string_2, string_3, number_slider, add)
reverse = List.Reverse(create_list)
number_2 = DoubleInput(3)
number_3 = DoubleInput(0..5..2)
add_2 = number_2 + number_3
slice = List.Slice(reverse, number_2, add_2)
