# Dynamo graph SliceList_NegativeTest.dyn (Dynamo 0.6.3.27696)

number = DoubleInput(3)
number_2 = DoubleInput(0..5..2)
string = StringInput("Dynamo")
number_3 = DoubleInput(4.5)
string_2 = StringInput("Design")
string_3 = StringInput("Script")
number_slider = DoubleSliderInput(50, range=0..100)
add = Addition(number_slider, number_3, lacing=Longest)
list = NewList(index0=string, index1=number_3, index2=string_2, index3=string_3, index4=number_slider, index5=add)
reverse = Reverse(list)
slice_list = SliceList(number, number_2, reverse)
