# Dynamo graph SliceList_SimpleTest.dyn (Dynamo 1.0.1.1743)

number = DoubleInput(1..10..#4)
number_2 = DoubleInput(0)
number_3 = DoubleInput(2)
add = number_2 + number_3
slice = List.Slice(number, number_2, add)
