# Dynamo graph Smooth_InputListNode.dyn (Dynamo 0.6.3.5265)

number = DoubleInput(54.36)
number_2 = DoubleInput(2.5412)
number_3 = DoubleInput(8.549)
number_4 = DoubleInput(84.256987)
list = NewList(index0=number, index1=number_2, index2=number_3, index3=number_4)
smooth = Smooth(list, lacing=Longest)
