# Dynamo graph Smooth_NegativeTest.dyn (Dynamo 0.6.3.5265)

string = StringInput("Dynamo")
string_2 = StringInput("DS")
number = DoubleInput(54.652)
list = NewList(index0=string, index1=string_2, index2=number)
smooth = Smooth(list, lacing=Longest)
