# Dynamo graph SortBy_SimpleTest.dyn (Dynamo 1.0.1.1743)

number = DoubleInput(10.23)
number_2 = DoubleInput(5.6)
number_3 = DoubleInput(98)
number_4 = DoubleInput(0.45)
number_5 = DoubleInput(8)
create_list = List.Create(number, number_2, number_3, number_4, number_5)
lessThan = Compare.LessThan(arg1=number_5)
sortByFunction = SortByFunction(create_list, lessThan)
watch = Watch(sortByFunction)
watch_2 = Watch(create_list)
