# Dynamo graph Sort_NumbersfFromDiffInput.dyn (Dynamo 1.0.1.1743)

number = DoubleInput(0.7853981634)
degreesToRadians = Math.DegreesToRadians(number)
radiansToDegrees = Math.RadiansToDegrees(degreesToRadians)
sin = Math.Sin(radiansToDegrees, lacing=Longest)
number_2 = DoubleInput(1.047197551)
degreesToRadians_2 = Math.DegreesToRadians(number_2)
radiansToDegrees_2 = Math.RadiansToDegrees(degreesToRadians_2)
cos = Math.Cos(radiansToDegrees_2, lacing=Longest)
number_3 = DoubleInput(0.5235987756)
degreesToRadians_3 = Math.DegreesToRadians(number_3)
radiansToDegrees_3 = Math.RadiansToDegrees(degreesToRadians)
tan = Math.Tan(radiansToDegrees_3, lacing=Longest)
number_4 = DoubleInput(1)
create_list = List.Create(degreesToRadians_3, degreesToRadians)
getItemAtIndex = List.GetItemAtIndex(list=create_list, index=number_4)
number_slider = DoubleSlider(-3.76498801, range=-10..10 step 0.1)
boolean = DoubleInput(0)
create_list_2 = List.Create(sin, cos, degreesToRadians_3, tan, number_4, getItemAtIndex, number_slider, boolean)
sort = List.Sort(create_list_2)
watch = Watch(sort)
watch_2 = Watch(create_list_2)
