# Dynamo graph Sort_SimpleNumbers.dyn (Dynamo 1.0.1.1743)

number = DoubleInput(2)
number_2 = DoubleInput(0)
number_3 = DoubleInput(9)
number_4 = DoubleInput(10)
number_5 = DoubleInput(3.5)
number_6 = DoubleInput(7)
number_7 = DoubleInput(4.6)
number_8 = DoubleInput(1.7)
create_list = List.Create(number, number_2, number_3, number_4, number_5, number_6, number_7, number_8)
sort = List.Sort(create_list)
watch = Watch(sort)
watch_2 = Watch(create_list)
