# Dynamo graph Sort_Strings&Numbers.dyn (Dynamo 1.0.1.1743)

string = StringInput("dddd")
string_2 = StringInput("aa")
string_3 = StringInput("a")
number = DoubleInput(0)
string_4 = StringInput("bbbbbbbbbbbbb")
create_list = List.Create(string, string_2, string_3, number, string_4)
sort = List.Sort(create_list)
watch = Watch(sort)
