# Dynamo graph Sort_Strings.dyn (Dynamo 1.0.1.1743)

string = StringInput("dddd")
string_2 = StringInput("aa")
string_3 = StringInput("a")
string_4 = StringInput("rrrrrrrrr")
string_5 = StringInput("bbbbbbbbbbbbb")
create_list = List.Create(string, string_2, string_3, string_4, string_5)
sort = List.Sort(create_list)
watch = Watch(sort)
watch_2 = Watch(create_list)
