# Dynamo graph SplitList_Complex.dyn

number = DoubleInput(0..10)
number_2 = DoubleInput(3)
build_sublists = Sublists("3", number, number_2, lacing=Longest)
split_list = DeCons(build_sublists)
watch = Watch(split_list.out1)
watch_2 = Watch(split_list.out0)
string = StringInput("Dynamo")
list = NewList(index0=number, index1=string)
watch_3 = Watch(build_sublists)
