# Dynamo graph SplitList_FirstElementAsList.dyn (Dynamo 1.0.1.1743)

number = DoubleInput(0..1)
string = StringInput("Dynamo")
create_list = List.Create(number, string)
deconstruct = List.Deconstruct(list=create_list)
watch = Watch(deconstruct.rest)
watch_2 = Watch(deconstruct.first)
