# Dynamo graph SplitList_NumberSequence.dyn

number = DoubleInput(0)
number_2 = DoubleInput(100)
number_3 = DoubleInput(5)
number_sequence = NumberSeq(number, number_2, number_3, lacing=Longest)
split_list = DeCons(number_sequence)
watch = Watch(split_list.out1)
watch_2 = Watch(split_list.out0)
