# Dynamo graph SplitList_SimpleTest.dyn (Dynamo 1.0.1.1743)

string = StringInput("Dynamo")
number = DoubleInput(0..1)
create_list = List.Create(string, number)
deconstruct = List.Deconstruct(list=create_list)
watch = Watch(deconstruct.rest)
watch_2 = Watch(deconstruct.first)
