# Dynamo graph TakeEveryNth_Complex.dyn (Dynamo 0.6.3.27696)

number = DoubleInput(2)
number_2 = DoubleInput(1)
number_3 = DoubleInput(5)
number_4 = DoubleInput(89.9)
number_5 = DoubleInput(34.56)
number_6 = DoubleInput(1)
number_7 = DoubleInput(0)
list = NewList(index0=number_3, index1=number_4, index2=number_5, index3=number_6, index4=number_7)
number_8 = DoubleInput(2.3)
string = StringInput("Dynamo")
string_2 = StringInput("Magneto")
string_3 = StringInput("Design")
string_4 = StringInput("Script")
list_2 = NewList(index0=string, index1=string_2, index2=string_3, index3=string_4)
list_3 = NewList(index0=number_2, index1=list, index2=number_8, index3=list_2)
number_9 = DoubleInput(1)
take_every_nth = TakeEveryNth(number, list_3, number_9)
watch = Watch(take_every_nth)
