# Dynamo graph TakeEveryNth_InputEmptyList.dyn (Dynamo 1.0.1.1743)

empty = List.Empty()
number = DoubleInput(2)
number_2 = DoubleInput(1)
takeEveryNthItem = List.TakeEveryNthItem(empty, number, number_2)
watch = Watch(takeEveryNthItem)
