# Dynamo graph TakeEveryNth_NegativeTest.dyn (Dynamo 1.0.1.1743)

number = DoubleInput(5..20)
string = StringInput("Dynamo")
number_2 = DoubleInput(3)
takeEveryNthItem = List.TakeEveryNthItem(number, string, number_2)
watch = Watch(takeEveryNthItem)
