# Dynamo graph TakeEveryNth_SimpleTest.dyn (Dynamo 1.0.1.1743)

number = DoubleInput(5..20)
number_2 = DoubleInput(3)
number_3 = DoubleInput(3)
takeEveryNthItem = List.TakeEveryNthItem(number, number_2, number_3)
watch = Watch(takeEveryNthItem)
