# Dynamo graph TakeFromList_AmtAsRangeExpn.dyn (Dynamo 1.0.1.1743)

number = DoubleInput(0)
number_slider = DoubleSlider(15, range=0..50 step 0.1)
number_2 = DoubleInput(1)
sequence = Sequence(start=number, amount=number_slider, step=number_2, lacing=Longest)
code_block = CodeBlock { {3}; }
number_3 = DoubleInput(3)
sublists = List.Sublists(list=sequence, ranges=code_block, offset=number_3)
number_4 = DoubleInput(1..2)
takeItems = List.TakeItems(list=sublists, amount=number_4)
watch = Watch(takeItems)
