# Dynamo graph TakeFromList_NegativeIntValue.dyn (Dynamo 1.0.1.1743)

string = StringInput("Test ")
string_2 = StringInput("Take ")
string_3 = StringInput("From ")
string_4 = StringInput("List")
create_list = List.Create(string, string_2, string_3, string_4)
number = DoubleInput(-1)
takeItems = List.TakeItems(list=create_list, amount=number)
watch = Watch(takeItems)
