# Dynamo graph TakeFromList_SimpleTest.dyn

number = DoubleInput(5)
number_2 = DoubleInput(0)
number_slider = DoubleSliderInput(15, range=0..50)
number_3 = DoubleInput(1)
number_range = NumberRange(number_2, number_slider, number_3, lacing=Longest)
number_4 = DoubleInput(3)
build_sublists = Sublists("3", number_range, number_4, lacing=Longest)
take_from_list = TakeList(number, build_sublists)
watch = Watch(take_from_list)
