# Dynamo graph TestAddToList.dyn

number = DoubleInput(150)
number_2 = DoubleInput(0)
number_3 = DoubleInput(100)
number_4 = DoubleInput(2)
number_range = NumberRange(number_2, number_3, number_4, lacing=Longest)
add_to_list = List(number, number_range)
watch = Watch(add_to_list)
