# Dynamo graph TestCombineNode_ListNumberRange.dyn

add = Addition(lacing=Longest)
number = DoubleInput(0)
number_2 = DoubleInput(1)
number_3 = DoubleInput(2)
number_4 = DoubleInput(3)
list = NewList(index0=number, index1=number_2, index2=number_3, index3=number_4)
number_5 = DoubleInput(0)
number_6 = DoubleInput(6)
number_7 = DoubleInput(2)
number_range = NumberRange(number_5, number_6, number_7, lacing=Longest)
combine = Combine(add, list, number_range)
watch = Watch(combine)
