# Dynamo graph TestDropEveryNth.dyn

number = DoubleInput(12)
number_2 = DoubleInput(120000)
number_3 = DoubleInput(240000)
number_4 = DoubleInput(100)
number_range = NumberRange(number_2, number_3, number_4, lacing=Longest)
number_5 = DoubleInput(0)
drop_every_nth = RemoveEveryNth(number, number_range, number_5)
watch = Watch(drop_every_nth)
