# Dynamo graph TestDropFromList.dyn

number = DoubleInput(149)
number_2 = DoubleInput(1000000)
number_3 = DoubleInput(150)
number_4 = DoubleInput(150)
number_sequence = NumberSeq(number_2, number_3, number_4, lacing=Longest)
drop_from_list = DropList(number, number_sequence)
watch = Watch(drop_from_list)
