# Dynamo graph TestEmpty.dyn

number = DoubleInput(120000)
number_2 = DoubleInput(240000)
number_3 = DoubleInput(100)
number_range = NumberRange(number, number_2, number_3, lacing=Longest)
number_4 = DoubleInput(12)
empty_list = Empty()
drop_every_nth = RemoveEveryNth(number_4, empty_list)
watch = Watch(drop_every_nth)
is_empty_list = IsEmpty(empty_list)
watch_2 = Watch(is_empty_list)
