# Dynamo graph TestExcelGetDataWorksheet.dyn

string = StringInput("C:\Users\t_phuot\Desktop\Testing.xlsx")
open_excel_workbook = ReadExcelFile(string)
string_2 = StringInput("Sheet1")
get_excel_worksheet_by_name = GetExcelWorksheetByName(open_excel_workbook, string_2)
get_data_from_excel_worksheet = GetDataFromExcelWorksheet(get_excel_worksheet_by_name)
watch = Watch(get_data_from_excel_worksheet)
