# Dynamo graph TestGetFromList.dyn

number = DoubleInput(99)
number_2 = DoubleInput(2000000000)
number_3 = DoubleInput(2000000100)
number_4 = DoubleInput(1)
number_range = NumberRange(number_2, number_3, number_4, lacing=Longest)
get_from_list = GetFromList(number, number_range)
watch = Watch(get_from_list)
