# Dynamo graph TestIntegrationConcatAndFlattenCompletelyList.dyn

string = StringInput("sometimes")
string_2 = StringInput("often")
list = NewList(index0=string, index1=string_2)
list_2 = NewList(index0=list, index1=string_2)
concatenate_lists = Append(list_2, list)
flatten_completely = FlattenList(concatenate_lists)
watch = Watch(flatten_completely)
rest_of_list = Rest(concatenate_lists)
watch_2 = Watch(rest_of_list)
