# Dynamo graph TestIsEmptyList.dyn

number = DoubleInput(0)
number_2 = DoubleInput(100000)
number_3 = DoubleInput(100)
number_sequence = NumberSeq(number, number_2, number_3, lacing=Longest)
is_empty_list = IsEmpty(number_sequence)
watch = Watch(is_empty_list)
