# Dynamo graph TestListJoinUseLevelsOnVariadicPort.dyn (Dynamo 2.14.0.0)

code_block = CodeBlock { [1,2]; }
code_block_2 = CodeBlock { [3,4]; }
join = List.Join(list0=code_block, list1=code_block_2@L1)
