# Dynamo graph TestMappingNode.dyn

XPlus5 = Custom[XPlus5]()
number = DoubleInput(10000)
number_2 = DoubleInput(20)
number_3 = DoubleInput(7)
number_sequence = NumberSeq(number, number_2, number_3, lacing=Longest)
map = Map(XPlus5, number_sequence)
watch = Watch(map)
