# Dynamo graph TestRemoveFromList.dyn

number = DoubleInput(99)
number_2 = DoubleInput(2000000000)
number_3 = DoubleInput(2000000100)
number_4 = DoubleInput(1)
number_range = NumberRange(number_2, number_3, number_4, lacing=Longest)
remove_from_list = RemoveFromList(number, number_range)
watch = Watch(remove_from_list)
