# Dynamo graph TestShiftIndeces.dyn

number = DoubleInput(5)
number_2 = DoubleInput(0)
number_3 = DoubleInput(100)
number_4 = DoubleInput(3)
number_sequence = NumberSeq(number_2, number_3, number_4, lacing=Longest)
shift_list_indeces = ShiftList(number, number_sequence)
watch = Watch(shift_list_indeces)
