# Dynamo graph TestTakeEveryNth.dyn

number = DoubleInput(2)
number_2 = DoubleInput(100000)
number_3 = DoubleInput(1000)
number_4 = DoubleInput(150)
number_sequence = NumberSeq(number_2, number_3, number_4, lacing=Longest)
number_5 = DoubleInput(0)
take_every_nth = TakeEveryNth(number, number_sequence, number_5)
watch = Watch(take_every_nth)
