# Dynamo graph TestTakeFromList.dyn

number = DoubleInput(5)
number_2 = DoubleInput(10000000)
number_3 = DoubleInput(150)
number_4 = DoubleInput(10)
number_sequence = NumberSeq(number_2, number_3, number_4, lacing=Longest)
take_from_list = TakeList(number, number_sequence)
watch = Watch(take_from_list)
