# Dynamo graph TrueForAll.dyn

compare100 = Custom[Compare100]()
number = DoubleInput(100)
number_2 = DoubleInput(90)
list = NewList(index0=number, index1=number_2)
true_for_all = AndMap(compare100, list)
