# Dynamo graph TrueForAll_SimpleTest.dyn (Dynamo 0.6.3.5265)

number = DoubleInput(6..8)
multiply = Multiplication(arg1=number, lacing=Longest)
number_2 = DoubleInput(5..10)
true_for_all = AndMap(multiply, number_2)
