# Dynamo graph TrueForAny.dyn

compare100 = Custom[Compare100]()
number = DoubleInput(0)
number_2 = DoubleInput(100)
number_3 = DoubleInput(2)
number_sequence = NumberSeq(number, number_2, number_3, lacing=Longest)
true_for_any = OrMap(compare100, number_sequence)
