# Dynamo graph TrueForAny_SimpleTest.dyn (Dynamo 0.6.3.5265)

number = DoubleInput(2)
divide = Division(arg1=number, lacing=Longest)
number_2 = DoubleInput(10..15)
true_for_any = OrMap(divide, number_2)
