# Dynamo graph createList.dyn (Dynamo 0.7.0.28166)

code_block = CodeBlock { 2; }
code_block_2 = CodeBlock { 4; }
create_list = List.Create(arg1=code_block, arg3=code_block_2)
code_block_3 = CodeBlock { 1; }
apply = Apply(create_list, code_block_3)
code_block_4 = CodeBlock { 3; }
apply_2 = Apply(apply, code_block_4)
watch = Watch(apply_2)
