# Dynamo graph listreplace.dyn (Dynamo 0.7.0.23447)

code_block = CodeBlock { {0, null, 2, null, null, 5}; }
code_block_2 = CodeBlock { "no value"; }
isNull = Object.IsNull()
replace = List.Replace(code_block, code_block_2, isNull)
