# Dynamo graph testBuildSubLists_emptyInput.dyn (Dynamo 1.0.1.1743)

empty = List.Empty()
code_block = CodeBlock { {0}; }
number = DoubleInput(1)
sublists = List.Sublists(list=empty, ranges=code_block, offset=number)
watch = Watch(sublists)
