# Dynamo graph testBuildSubLists_invalidInput.dyn (Dynamo 1.0.1.1743)

number = DoubleInput(20)
code_block = CodeBlock { {1}; }
number_2 = DoubleInput(10)
sublists = List.Sublists(list=number, ranges=code_block, offset=number_2)
watch = Watch(sublists)
