# Dynamo graph testBuildSubLists_stringInput.dyn

string = StringInput("a")
string_2 = StringInput("b")
string_3 = StringInput("c")
string_4 = StringInput("d")
list = NewList(index0=string, index1=string_2, index2=string_3, index3=string_4)
number = DoubleInput(2)
build_sublists = Sublists("1", list, number, lacing=Longest)
watch = Watch(build_sublists)
number_2 = DoubleInput(0)
number_3 = DoubleInput(1)
number_4 = DoubleInput(3)
number_5 = DoubleInput(4)
list_2 = NewList(index0=number_2, index1=number_3, index2=number, index3=number_4, index4=number_5)
