# Dynamo graph testConcatenateLists_normalInput.dyn

number = DoubleInput(10)
number_2 = DoubleInput(20)
number_3 = DoubleInput(10)
number_4 = DoubleInput(20)
number_5 = DoubleInput(10)
list = NewList(index0=number, index1=number_2, index2=number_3, index3=number_4, index4=number_5)
string = StringInput("a")
string_2 = StringInput("b")
string_3 = StringInput("a")
string_4 = StringInput("b")
list_2 = NewList(index0=string, index1=string_2, index2=string_3, index3=string_4)
concatenate_lists = Append(list, list_2)
watch = Watch(concatenate_lists)
