# Dynamo graph testDiagonaLeftList_emptyInput.dyn

empty_list = Empty()
number = DoubleInput(2)
diagonal_left_list = DiagonalLeftList(empty_list, number, lacing=Longest)
watch = Watch(diagonal_left_list)
