# Dynamo graph testDiagonaLeftList_invalidInput.dyn (Dynamo 1.0.1.1743)

number = DoubleInput(20)
number_2 = DoubleInput(10)
diagonalLeft = List.DiagonalLeft(number, number_2)
watch = Watch(diagonalLeft)
