# Dynamo graph testDiagonaLeftList_numberInput.dyn

number = DoubleInput(1)
number_2 = DoubleInput(2)
number_3 = DoubleInput(3)
number_4 = DoubleInput(4)
number_5 = DoubleInput(5)
list = NewList(index0=number, index1=number_2, index2=number_3, index3=number_4, index4=number_5)
diagonal_left_list = DiagonalLeftList(list, number_2, lacing=Longest)
watch = Watch(diagonal_left_list)
string = StringInput("a")
string_2 = StringInput("b")
string_3 = StringInput("a")
string_4 = StringInput("b")
list_2 = NewList(index0=string, index1=string_2, index2=string_3, index3=string_4)
