# Dynamo graph testDiagonaLeftList_stringInput.dyn

string = StringInput("a")
string_2 = StringInput("b")
string_3 = StringInput("a")
string_4 = StringInput("b")
list = NewList(index0=string, index1=string_2, index2=string_3, index3=string_4)
number = DoubleInput(2)
diagonal_left_list = DiagonalLeftList(list, number, lacing=Longest)
watch = Watch(diagonal_left_list)
number_2 = DoubleInput(1)
number_3 = DoubleInput(3)
number_4 = DoubleInput(4)
number_5 = DoubleInput(5)
list_2 = NewList(index0=number_2, index1=number, index2=number_3, index3=number_4, index4=number_5)
