# Dynamo graph testFilterOnEmptyInput.dyn (Dynamo 0.8.1.1022)

empty = List.Empty()
code_block = CodeBlock { 1; }
lt = _ < code_block
filter = List.Filter(empty, lt)
watch = Watch(filter.out0)
watch_2 = Watch(filter.out1)
