# Dynamo graph testIntegration1.dyn

number = DoubleInput(1)
number_2 = DoubleInput(0)
number_3 = DoubleInput(99999999999999)
list = NewList(index0=number, index1=number_2, index2=number_3)
list_length = Length(list)
repeat = Repeat(list, list_length, lacing=Longest)
flatten = FlattenListAmt(repeat, number)
first_of_list = First(flatten)
watch = Watch(first_of_list)
watch_2 = Watch(repeat)
is_empty_list = IsEmpty(watch_2)
watch_3 = Watch(is_empty_list)
watch_4 = Watch(flatten)
