# Dynamo graph testIsEmptyList_numberInput.dyn

number = DoubleInput(2)
number_2 = DoubleInput(2)
number_3 = DoubleInput(2)
number_4 = DoubleInput(2)
number_5 = DoubleInput(2)
number_6 = DoubleInput(2)
number_7 = DoubleInput(2)
number_8 = DoubleInput(2)
number_9 = DoubleInput(2)
number_10 = DoubleInput(2)
list = NewList(index0=number, index1=number_2, index2=number_3, index3=number_4, index4=number_5, index5=number_6, index6=number_7, index7=number_8, index8=number_9, index9=number_10)
is_empty_list = IsEmpty(list)
watch = Watch(is_empty_list)
