# Dynamo graph testIsEmptyList_stringInput.dyn (Dynamo 1.0.1.1743)

string = StringInput("1")
string_2 = StringInput("2")
string_3 = StringInput("3")
string_4 = StringInput("4")
string_5 = StringInput("5")
string_6 = StringInput("6")
string_7 = StringInput("7")
string_8 = StringInput("8")
string_9 = StringInput("9")
string_10 = StringInput("10")
create_list = List.Create(string, string_2, string_3, string_4, string_5, string_6, string_7, string_8, string_9, string_10)
isEmpty = List.IsEmpty(create_list)
watch = Watch(isEmpty)
