# Dynamo graph testListChop.dyn (Dynamo 0.9.1.3440)

code_block = CodeBlock { {1,2,3,4,5}; }
code_block_2 = CodeBlock { 2.4; }
chop = List.Chop(list=code_block, lengths=code_block_2)
watch = Watch(chop)
