# Dynamo graph testListLength_numberInput.dyn (Dynamo 1.0.1.1743)

number = DoubleInput(10)
number_2 = DoubleInput(20)
number_3 = DoubleInput(10)
number_4 = DoubleInput(20)
number_5 = DoubleInput(10)
create_list = List.Create(number, number_2, number_3, number_4, number_5)
count = List.Count(create_list)
watch = Watch(count)
