# Dynamo graph testNestedMap.dyn (Dynamo 0.7.1.18614)

code_block = CodeBlock { {{1}}; }
code_block_2 = CodeBlock { 2; }
mul = _ * code_block_2
map = List.Map(arg1=mul)
map_2 = List.Map(code_block, map)
code_block_3 = CodeBlock(r=map_2) { v = r[0][0]; }
watch = Watch(code_block_3)
