# Dynamo graph testPartitionList_stringInput.dyn (Dynamo 1.0.1.1743)

string = StringInput("a")
string_2 = StringInput("b")
string_3 = StringInput("a")
string_4 = StringInput("b")
create_list = List.Create(string, string_2, string_3, string_4)
number = DoubleInput(3)
chop = List.Chop(list=create_list, lengths=number)
watch = Watch(chop)
number_2 = DoubleInput(1)
number_3 = DoubleInput(2)
number_4 = DoubleInput(4)
number_5 = DoubleInput(5)
create_list_2 = List.Create(number_2, number_3, number, number_4, number_5)
