# Dynamo graph testPlatten_normalInput.dyn (Dynamo 1.0.1.1743)

number = DoubleInput(0)
number_2 = DoubleInput(1)
number_3 = DoubleInput(2)
number_4 = DoubleInput(3)
number_5 = DoubleInput(4)
create_list = List.Create(number, number_2, number_3, number_4, number_5)
string = StringInput("a")
string_2 = StringInput("b")
string_3 = StringInput("c")
string_4 = StringInput("d")
create_list_2 = List.Create(string, string_2, string_3, string_4)
create_list_3 = List.Create(create_list, create_list_2)
create_list_4 = List.Create(create_list_3, create_list_2)
flatten = List.Flatten(list=create_list_4, amt=number_2)
watch = Watch(flatten)
