# Dynamo graph testRepeat_emptyInput.dyn (Dynamo 1.0.1.1743)

empty = List.Empty()
number = DoubleInput(2)
ofRepeatedItem = List.OfRepeatedItem(item=empty, amount=number)
watch = Watch(ofRepeatedItem)
