# Dynamo graph testRepeat_numberInput.dyn (Dynamo 1.0.1.1743)

number = DoubleInput(0)
number_2 = DoubleInput(1)
number_3 = DoubleInput(2)
number_4 = DoubleInput(3)
number_5 = DoubleInput(4)
create_list = List.Create(number, number_2, number_3, number_4, number_5)
ofRepeatedItem = List.OfRepeatedItem(item=create_list, amount=number_3)
watch = Watch(ofRepeatedItem)
string = StringInput("a")
string_2 = StringInput("b")
string_3 = StringInput("c")
string_4 = StringInput("d")
create_list_2 = List.Create(string, string_2, string_3, string_4)
