# Dynamo graph testRestOfList_stringInput.dyn (Dynamo 1.0.1.1743)

string = StringInput("a")
string_2 = StringInput("b")
string_3 = StringInput("a")
string_4 = StringInput("b")
create_list = List.Create(string, string_2, string_3, string_4)
restOfItems = List.RestOfItems(create_list)
watch = Watch(restOfItems)
number = DoubleInput(10)
number_2 = DoubleInput(20)
number_3 = DoubleInput(10)
number_4 = DoubleInput(20)
number_5 = DoubleInput(10)
create_list_2 = List.Create(number, number_2, number_3, number_4, number_5)
