# Dynamo graph testUniqueItemsForNullList.dyn (Dynamo 0.7.4.3160)

code_block = CodeBlock { {null, null, null}; }
uniqueItems = List.UniqueItems(code_block)
code_block_2 = CodeBlock { {null, 1, null}; }
uniqueItems_2 = List.UniqueItems(code_block_2)
