# Dynamo graph transpose.dyn (Dynamo 0.7.0.22126)

code_block = CodeBlock { {{1,2}, {3,4}}; }
transpose = List.Transpose(code_block)
code_block_2 = CodeBlock { {{1,2, 3}, {4, 5}, {6, 7, 8, 9}}; }
transpose_2 = List.Transpose(code_block_2)
code_block_3 = CodeBlock { {{{1},2}, {3,4}}; }
transpose_3 = List.Transpose(code_block_3)
code_block_4 = CodeBlock { {}; }
transpose_4 = List.Transpose(code_block_4)
code_block_5 = CodeBlock { {1, 2}; }
transpose_5 = List.Transpose(code_block_5)
code_block_6 = CodeBlock { 1; }
transpose_6 = List.Transpose(code_block_6)
