# Dynamo graph testCompare_BooleanBoolean.dyn (Dynamo 1.0.1.1743)

boolean = BoolSelector(true)
boolean_2 = BoolSelector(false)
lessThan = Compare.LessThan(boolean, boolean_2)
watch = Watch(lessThan)
lessThan_2 = Compare.LessThan(boolean_2, boolean)
watch_2 = Watch(lessThan_2)
greaterThanOrEqual = Compare.GreaterThanOrEqual(boolean, boolean_2)
watch_3 = Watch(greaterThanOrEqual)
greaterThanOrEqual_2 = Compare.GreaterThanOrEqual(boolean_2, boolean)
watch_4 = Watch(greaterThanOrEqual_2)
