# Dynamo graph testCompare_BooleanInteger.dyn (Dynamo 1.0.1.1743)

boolean = BoolSelector(true)
integer_slider = IntegerSlider(2, range=0..5 step 1)
lessThan = Compare.LessThan(boolean, integer_slider)
watch = Watch(lessThan)
lessThan_2 = Compare.LessThan(integer_slider, boolean)
watch_2 = Watch(lessThan_2)
greaterThanOrEqual = Compare.GreaterThanOrEqual(boolean, integer_slider)
watch_3 = Watch(greaterThanOrEqual)
greaterThanOrEqual_2 = Compare.GreaterThanOrEqual(integer_slider, boolean)
watch_4 = Watch(greaterThanOrEqual_2)
