# Dynamo graph testCompare_DoubleInteger.dyn (Dynamo 1.0.1.1743)

number = DoubleInput(2.35)
integer_slider = IntegerSlider(2, range=0..5 step 1)
lessThan = Compare.LessThan(number, integer_slider)
watch = Watch(lessThan)
lessThan_2 = Compare.LessThan(integer_slider, number)
watch_2 = Watch(lessThan_2)
greaterThanOrEqual = Compare.GreaterThanOrEqual(number, integer_slider)
watch_3 = Watch(greaterThanOrEqual)
greaterThanOrEqual_2 = Compare.GreaterThanOrEqual(integer_slider, number)
watch_4 = Watch(greaterThanOrEqual_2)
