# Dynamo graph testCompare_StringDouble.dyn (Dynamo 0.6.2.20018)

string = StringInput("a")
number = DoubleInput(3)
less_than = LessThan(string, number)
watch = Watch(less_than)
less_than_2 = LessThan(number, string)
watch_2 = Watch(less_than_2)
greater_than_or_equal = GreaterThanEquals(string, number)
watch_3 = Watch(greater_than_or_equal)
greater_than_or_equal_2 = GreaterThanEquals(number, string)
watch_4 = Watch(greater_than_or_equal_2)
