# Dynamo graph testCompare_StringInteger.dyn (Dynamo 1.0.1.1743)

string = StringInput("a")
integer_slider = IntegerSlider(2, range=0..5 step 1)
lessThan = Compare.LessThan(string, integer_slider)
watch = Watch(lessThan)
lessThan_2 = Compare.LessThan(integer_slider, string)
watch_2 = Watch(lessThan_2)
greaterThanOrEqual = Compare.GreaterThanOrEqual(string, integer_slider)
watch_3 = Watch(greaterThanOrEqual)
greaterThanOrEqual_2 = Compare.GreaterThanOrEqual(integer_slider, string)
watch_4 = Watch(greaterThanOrEqual_2)
