# Dynamo graph testEqualStringInput.dyn (Dynamo 1.0.1.1743)

string = StringInput("a")
eq = string == string
watch = Watch(eq)
string_2 = StringInput("b")
eq_2 = string == string_2
watch_2 = Watch(eq_2)
