# Dynamo graph testGreaterThanNumberInput.dyn (Dynamo 1.0.1.1743)

number = DoubleInput(1)
number_2 = DoubleInput(2)
greaterThan = Compare.GreaterThan(number, number_2)
watch = Watch(greaterThan)
greaterThan_2 = Compare.GreaterThan(number_2, number)
watch_2 = Watch(greaterThan_2)
