# Dynamo graph testGreaterThanOrEqualInvalidInput.dyn (Dynamo 1.0.1.1743)

string = StringInput("a")
number = DoubleInput(1)
greaterThanOrEqual = Compare.GreaterThanOrEqual(string, number)
watch = Watch(greaterThanOrEqual)
