# Dynamo graph testGreaterThanOrEqualNumberInput.dyn (Dynamo 1.0.1.1743)

number = DoubleInput(1)
number_2 = DoubleInput(2)
greaterThanOrEqual = Compare.GreaterThanOrEqual(number, number_2)
watch = Watch(greaterThanOrEqual)
greaterThanOrEqual_2 = Compare.GreaterThanOrEqual(number_2, number)
watch_2 = Watch(greaterThanOrEqual_2)
greaterThanOrEqual_3 = Compare.GreaterThanOrEqual(number_2, number)
watch_3 = Watch(greaterThanOrEqual_3)
