# Dynamo graph testGreaterThanOrEqualStringInput.dyn (Dynamo 1.0.1.1743)

string = StringInput("a")
string_2 = StringInput("b")
greaterThanOrEqual = Compare.GreaterThanOrEqual(string, string_2)
watch = Watch(greaterThanOrEqual)
greaterThanOrEqual_2 = Compare.GreaterThanOrEqual(string, string)
watch_2 = Watch(greaterThanOrEqual_2)
greaterThanOrEqual_3 = Compare.GreaterThanOrEqual(string_2, string)
watch_3 = Watch(greaterThanOrEqual_3)
