# Dynamo graph testGreaterThanStringInput.dyn (Dynamo 1.0.1.1743)

string = StringInput("a")
string_2 = StringInput("b")
greaterThan = Compare.GreaterThan(string, string_2)
watch = Watch(greaterThan)
greaterThan_2 = Compare.GreaterThan(string_2, string)
watch_2 = Watch(greaterThan_2)
