# Dynamo graph testLessThanInvalidInput.dyn (Dynamo 1.0.1.1743)

string = StringInput("a")
number = DoubleInput(1)
lessThan = Compare.LessThan(string, number)
lessThan_2 = Compare.LessThan(number, string)
