# Dynamo graph testLessThanNumberInput.dyn (Dynamo 1.0.1.1743)

number = DoubleInput(5)
number_2 = DoubleInput(10)
lessThan = Compare.LessThan(number, number_2)
watch = Watch(lessThan)
number_3 = DoubleInput(10)
number_4 = DoubleInput(5)
lessThan_2 = Compare.LessThan(number_3, number_4)
watch_2 = Watch(lessThan_2)
