# Dynamo graph testLessThanOrEqualNumberInput.dyn (Dynamo 1.0.1.1743)

number = DoubleInput(5)
number_2 = DoubleInput(10)
lessThanOrEqual = Compare.LessThanOrEqual(number, number_2)
watch = Watch(lessThanOrEqual)
lessThanOrEqual_2 = Compare.LessThanOrEqual(number, number)
watch_2 = Watch(lessThanOrEqual_2)
lessThanOrEqual_3 = Compare.LessThanOrEqual(number_2, number)
watch_3 = Watch(lessThanOrEqual_3)
