# Dynamo graph testLessThanOrEqualStringInput.dyn (Dynamo 1.0.1.1743)

string = StringInput("a")
string_2 = StringInput("b")
lessThanOrEqual = Compare.LessThanOrEqual(string, string_2)
watch = Watch(lessThanOrEqual)
lessThanOrEqual_2 = Compare.LessThanOrEqual(string, string)
watch_2 = Watch(lessThanOrEqual_2)
lessThanOrEqual_3 = Compare.LessThanOrEqual(string_2, string)
watch_3 = Watch(lessThanOrEqual_3)
