# Dynamo graph testLessThanStringInput.dyn (Dynamo 1.0.1.1743)

string = StringInput("a")
string_2 = StringInput("b")
lessThan = Compare.LessThan(string, string_2)
watch = Watch(lessThan)
lessThan_2 = Compare.LessThan(string_2, string)
watch_2 = Watch(lessThan_2)
