# Dynamo graph testToleranceEquals_defaultTolerance.dyn (Dynamo 2.5.0.6316)

code_block = CodeBlock { 0.0; 0.00001; }
eq = Equals(lhs=code_block.out0, rhs=code_block.out1)
eq_2 = code_block.out0 == code_block.out1
