# Dynamo graph testToleranceEquals_lacing.dyn (Dynamo 2.5.0.6324)

code_block = CodeBlock { 1..2; 1..4; }
eq = Equals(x=code_block.out0, y=code_block.out1, lacing=Shortest)
eq_2 = Equals(x=code_block.out0, y=code_block.out1, lacing=CrossProduct)
eq_3 = Equals(x=code_block.out0, y=code_block.out1, lacing=Longest)
