# Dynamo graph testToleranceEquals_map.dyn (Dynamo 2.5.0.6317)

code_block = CodeBlock { 1..2; 1..4; }
eq = Equals(lhs=code_block.out0, rhs=code_block.out1)
code_block_2 = CodeBlock { 0.00001; }
eq_2 = Equals(lhs=code_block.out0, rhs=code_block.out1)  # unwired: tolerance
map = List.Map(list=code_block_2, f_x=eq_2)
code_block_3 = CodeBlock(a=map) { a; }
