# Dynamo graph testToleranceEquals_map2.dyn (Dynamo 2.5.0.6317)

code_block = CodeBlock { 1..2; 1..4; }
eq = Equals(lhs=code_block.out0, lacing=Longest)  # unwired: rhs
map = List.Map(list=code_block.out1, f_x=eq)
code_block_2 = CodeBlock(a=map) { a; }
