# Dynamo custom node PassNothingBelow1.dyf (Dynamo 0.7.1.26709)
# category: buildz
# Takes inputs and only passes 1 or values above 1

x = Input()
number = DoubleInput(1)
lessThan = Compare.LessThan(x, number)
if_ = If(lessThan, number, x)
ret = Output(if_)
