# Dynamo custom node factorial.dyf (Dynamo 0.7.1.17362)
# category: Util

x = Input()
code_block = CodeBlock { 1; }
le = x <= code_block
code_block_2 = CodeBlock { 1; }
code_block_3 = CodeBlock { 1; }
sub = x - code_block_3
factorial = Custom[factorial](x=sub)
mul = x * factorial
scopeIf = ScopedIf(le, code_block_2, mul)
Output = Output(scopeIf)  # ""
