# Dynamo graph testAndNumberInput.dyn (Dynamo 1.0.1.1743)

number = DoubleInput(1)
number_2 = DoubleInput(0)
and_ = And(number, number_2)
watch = Watch(and_)
number_3 = DoubleInput(1)
number_4 = DoubleInput(1)
and_2 = And(number_3, number_4)
watch_2 = Watch(and_2)
number_5 = DoubleInput(0)
number_6 = DoubleInput(0)
and_3 = And(number_5, number_6)
watch_3 = Watch(and_3)
