# Dynamo graph testAndStringInput.dyn (Dynamo 1.0.1.1743)

string = StringInput("a")
string_2 = StringInput("b")
and_ = And(string, string_2)
watch = Watch(and_)
string_3 = StringInput("a")
string_4 = StringInput("a")
and_2 = And(string_3, string_4)
watch_2 = Watch(and_2)
