# Dynamo graph testIFAsFunctionObject.dyn (Dynamo 1.0.1.1743)

code_block = CodeBlock { {true, false, false, true}; }
code_block_2 = CodeBlock { 43; }
code_block_3 = CodeBlock { 144; }
if_ = If(true=code_block_2, false=code_block_3)
map = List.Map(list=code_block, f_x=if_)
code_block_4 = CodeBlock { {1,2,3,4}; }
code_block_5 = CodeBlock { false; }
code_block_6 = CodeBlock { 42; }
if_2 = If(test=code_block_5, true=code_block_6)
map_2 = List.Map(list=code_block_4, f_x=if_2)
