# Dynamo graph testIFInCustomNode1.dyn (Dynamo 0.7.0.30500)

code_block = CodeBlock { -3..3; }
passNothingBelow1 = Custom[PassNothingBelow1]()  # Takes inputs and only passes 1 or values above 1
map = List.Map(code_block, passNothingBelow1)
watch = Watch(map)
