# Dynamo graph testIfBasic.dyn (Dynamo 1.0.1.1743)

number_slider = DoubleSlider(5, range=0..100 step 0.1)
code_block = CodeBlock { 1.0; }
lt = number_slider < code_block
if_ = If(test=lt, true=code_block, false=number_slider)
code_block_2 = CodeBlock { -3..3; }
code_block_3 = CodeBlock { 1.0; }
lt_2 = code_block_2 < code_block_3
if_2 = If(test=lt_2, true=code_block_3, false=code_block_2)
