# Dynamo graph testIfNumberInput.dyn (Dynamo 1.0.1.1743)

number = DoubleInput(1)
number_2 = DoubleInput(1)
number_3 = DoubleInput(0)
if_ = If(test=number, true=number_2, false=number_3)
watch = Watch(if_)
number_4 = DoubleInput(0)
number_5 = DoubleInput(1)
number_6 = DoubleInput(0)
if_2 = If(test=number_4, true=number_5, false=number_6)
watch_2 = Watch(if_2)
number_7 = DoubleInput(1)
number_8 = DoubleInput(0)
number_9 = DoubleInput(0)
if_3 = If(test=number_7, true=number_8, false=number_9)
watch_3 = Watch(if_3)
number_10 = DoubleInput(1)
number_11 = DoubleInput(0)
number_12 = DoubleInput(1)
if_4 = If(test=number_10, true=number_11, false=number_12)
watch_4 = Watch(if_4)
number_13 = DoubleInput(0)
number_14 = DoubleInput(0)
number_15 = DoubleInput(1)
if_5 = If(test=number_13, true=number_14, false=number_15)
watch_5 = Watch(if_5)
number_16 = DoubleInput(0)
number_17 = DoubleInput(3)
number_18 = DoubleInput(3)
if_6 = If(test=number_16, true=number_17, false=number_18)
watch_6 = Watch(if_6)
