# Dynamo graph testIntegrationConditionalAndComparisonNodes.dyn

number = DoubleInput(50)
number_2 = DoubleInput(99999999999999.0)
greater_than_or_equal = GreaterThanEquals(number, number_2)
less_than = LessThan(number, number_2)
or_ = Or(greater_than_or_equal, less_than)
watch = Watch(or_)
and_ = And(or_, greater_than_or_equal)
watch_2 = Watch(and_)
watch_3 = Watch(less_than)
watch_4 = Watch(greater_than_or_equal)
