# Dynamo graph testIntegrationConditionalNodes.dyn

number = DoubleInput(1)
number_2 = DoubleInput(0)
xor = Xor(number, number_2)
not_ = Not(xor)
or_ = Or(number_2, number)
and_ = And(or_, xor)
if_ = Conditional(not_, and_, or_)
watch = Watch(if_)
watch_2 = Watch(and_)
watch_3 = Watch(not_)
watch_4 = Watch(or_)
watch_5 = Watch(xor)
