# Dynamo graph testNewIf.dyn (Dynamo 2.11.0.5135)

boolean = BoolSelector(true)
code_block = CodeBlock { ["a1","b1","c1"]; [["a2"],"b2"]; [1,[2],3]; [4,5]; }
if_ = RefactoredIf(test=boolean, true=code_block.out0, false=code_block.out1)
if_2 = RefactoredIf(test=boolean, true=code_block.out2@L3, false=code_block.out3@L3)
if_3 = RefactoredIf(test=boolean, false=code_block.out3)  # unwired: true
