# Dynamo graph testNotNumberInput.dyn (Dynamo 1.0.1.1743)

number = DoubleInput(1)
not_ = Not(number)
watch = Watch(not_)
number_2 = DoubleInput(0)
not_2 = Not(number_2)
watch_2 = Watch(not_2)
watch_3 = Watch()
