# Dynamo graph testOrNumberInput.dyn (Dynamo 1.0.1.1743)

number = DoubleInput(1)
number_2 = DoubleInput(0)
or_ = Or(number, number_2)
watch = Watch(or_)
number_3 = DoubleInput(1)
number_4 = DoubleInput(1)
or_2 = Or(number_3, number_4)
watch_2 = Watch(or_2)
number_5 = DoubleInput(0)
number_6 = DoubleInput(0)
or_3 = Or(number_5, number_6)
watch_3 = Watch(or_3)
