# Dynamo graph testScopeIf.dyn (Dynamo 0.7.5.3220)

code_block = CodeBlock { true; }
code_block_2 = CodeBlock { 42; }
code_block_3 = CodeBlock { 24; }
scopeIf = ScopedIf(code_block, code_block_2, code_block_3)
watch = Watch(scopeIf)
