# Dynamo graph testVariableInputOrAndNodesL@L.dyn (Dynamo 2.14.0.3891)

code_block = CodeBlock { [true, false]; }
or_ = Or(bool0=code_block@L2, bool1=code_block, lacing=CrossProduct)
and_ = And(bool0=code_block, bool1=code_block@L2, lacing=CrossProduct)
