# Dynamo graph testXorNumberInput.dyn (Dynamo 1.0.1.1743)

number = DoubleInput(1)
number_2 = DoubleInput(0)
xor = Logic.Xor(number, number_2)
watch = Watch(xor)
number_3 = DoubleInput(1)
number_4 = DoubleInput(1)
xor_2 = Logic.Xor(number_3, number_4)
watch_2 = Watch(xor_2)
number_5 = DoubleInput(0)
number_6 = DoubleInput(0)
xor_3 = Logic.Xor(number_5, number_6)
watch_3 = Watch(xor_3)
