# Dynamo graph testIntegration1.dyn

number = DoubleInput(100)
greater_than = GreaterThan(number, number)
number_2 = DoubleInput(50)
less_than_or_equal = LessThanEquals(number_2, number_2)
greater_than_or_equal = GreaterThanEquals(greater_than, less_than_or_equal)
watch = Watch(greater_than_or_equal)
less_than = LessThan(number, number_2)
equal = Equal(less_than, greater_than_or_equal)
watch_2 = Watch(equal)
watch_3 = Watch(less_than_or_equal)
watch_4 = Watch(greater_than)
watch_5 = Watch(less_than)
