# Dynamo graph testIntegration3.dyn

number = DoubleInput(50)
number_2 = DoubleInput(100)
greater_than_or_equal = GreaterThanEquals(number, number_2)
less_than = LessThan(number, number_2)
or_ = Or(greater_than_or_equal, less_than)
and_ = And(or_, greater_than_or_equal)
watch = Watch(and_)
watch_2 = Watch(or_)
watch_3 = Watch(greater_than_or_equal)
watch_4 = Watch(less_than)
