# Dynamo graph map_reduce_filter.dyn

number = DoubleInput(4)
add = Addition(arg1=number)
number_2 = DoubleInput(2)
list = NewList(index0=number_2, index1=number_2, index2=number_2)
map = Map(add, list)
watch = Watch(map)
number_3 = DoubleInput(5)
greater_than = GreaterThan(arg1=number_3)
number_4 = DoubleInput(0)
number_5 = DoubleInput(10)
number_6 = DoubleInput(1)
number_sequence = BuildSeq(number_4, number_5, number_6)
filter = Filter(greater_than, number_sequence)
watch_2 = Watch(filter)
add_2 = Addition()
number_7 = DoubleInput(0)
number_8 = DoubleInput(2)
list_2 = NewList(index0=number_8, index1=number_8, index2=number_8)
reduce = Fold(add_2, number_7, list_2)
watch_3 = Watch(reduce)
number_9 = DoubleInput(2)
number_10 = DoubleInput(5)
add_3 = Addition(number_9, number_10)
number_11 = DoubleInput(0)
number_12 = DoubleInput(10)
add_4 = Addition(number_11, number_12)
subtract = Subtraction(add_3, add_4)
watch_4 = Watch(subtract)
