# Dynamo graph Cosine.dyn (Dynamo 1.0.1.1743)

PI = Math.PI()
number = DoubleInput(1)
div = PI / number  # lacing=Longest
radiansToDegrees = Math.RadiansToDegrees(div)
cos = Math.Cos(radiansToDegrees, lacing=Longest)
watch = Watch(cos)
