# Dynamo graph Modulo.dyn (Dynamo 1.2.1.2720)

number = DoubleInput(2)
number_2 = DoubleInput(2)
mod = number % number_2  # lacing=Longest
watch = Watch(mod)
code_block = CodeBlock { -2; 5; }
mod_2 = code_block.out0 % code_block.out1
watch_2 = Watch(mod_2)
code_block_2 = CodeBlock { -2.0; 5.0; }
mod_3 = code_block_2.out0 % code_block_2.out1
watch_3 = Watch(mod_3)
