# Dynamo graph ModuloDividendLargerThanDivisor.dyn (Dynamo 0.8.0.681)

code_block = CodeBlock { {12.129,8.026,11.899,7.83}; }
code_block_2 = CodeBlock { 2; }
code_block_3 = CodeBlock(x=code_block, y=code_block_2) { x%y; }
code_block_4 = CodeBlock(num=code_block_3) { num==0; }
mod = code_block % code_block_2
python_script = Python(IN[0]=code_block, IN[1]=code_block_2)
# ---------- python_script.python (15 lines) ----------
import clr
clr.AddReference('ProtoGeometry')
from Autodesk.DesignScript.Geometry import *
#The inputs to this node will be stored as a list in the IN variable.
dataEnteringNode = IN

#Assign your output to the OUT variable
numbers = IN[0]
num = IN[1]

results = []
for i in range(len(numbers)):
    results.append(numbers[i] % num)

OUT = results
# ----------------------------------------
