# Dynamo graph Sine.dyn (Dynamo 1.0.1.1743)

PI = Math.PI()
number = DoubleInput(2)
div = PI / number  # lacing=Longest
radiansToDegrees = Math.RadiansToDegrees(div)
sin = Math.Sin(radiansToDegrees, lacing=Longest)
watch = Watch(sin)
