# Dynamo graph AllExcelNodes_MAGN2343.dyn (Dynamo 1.0.1.1743)

file_path = Filename("D:\FromF\DynamoProject\Graphs\MigrationDYN\helix.xlsx")
readExcelFile = Excel.ReadExcelFile(file_path)
string = StringInput("helix")
getExcelWorksheetByName = Excel.GetExcelWorksheetByName(readExcelFile, string)
getDataFromExcelWorksheet = Excel.GetDataFromExcelWorksheet(getExcelWorksheetByName)
watch = Watch(getDataFromExcelWorksheet)
transpose = List.Transpose(getDataFromExcelWorksheet)
watch_2 = Watch(transpose)
number = DoubleInput(0)
getItemAtIndex = List.GetItemAtIndex(list=transpose, index=number)
number_2 = DoubleInput(1)
getItemAtIndex_2 = List.GetItemAtIndex(list=transpose, index=number_2)
number_3 = DoubleInput(2)
getItemAtIndex_3 = List.GetItemAtIndex(list=transpose, index=number_3)
byCoordinates = Point.ByCoordinates(x=getItemAtIndex, y=getItemAtIndex_2, z=getItemAtIndex_3, lacing=Longest)
watch_3d = Watch3D(byCoordinates)
watch_3 = Watch(getItemAtIndex)
