# Dynamo graph BoxByTwoCorners_3359.dyn (Dynamo 1.0.1.1743)

code_block = CodeBlock { Point.ByCoordinates(-1,-1,-1); }
code_block_2 = CodeBlock { Point.ByCoordinates(1,1,1); }
byCorners = Cuboid.ByCorners(lowPoint=code_block, highPoint=code_block_2, lacing=Longest)
