# Dynamo graph ColorRange_3065.dyn (Dynamo 1.0.1.1743)

number = DoubleInput(0)
number_2 = DoubleInput(255)
byARGB = Color.ByARGB(a=number, r=number_2, g=number, b=number, lacing=Longest)
byARGB_2 = Color.ByARGB(a=number, r=number, g=number_2, b=number_2, lacing=Longest)
create_list = List.Create(byARGB, byARGB_2)
number_3 = DoubleInput(0)
number_4 = DoubleInput(100)
byARGB_3 = Color.ByARGB(a=number_3, r=number_4, g=number_3, b=number_3, lacing=Longest)
byARGB_4 = Color.ByARGB(a=number_3, r=number_3, g=number_4, b=number_3, lacing=Longest)
create_list_2 = List.Create(byARGB_3, byARGB_4)
number_5 = DoubleInput(0..1..#25)
color_range = ColorRange(create_list, create_list_2, number_5)
