# Dynamo graph Dynamo.Nodes.NumberInput-0.6.3.25334.dyn (Dynamo 0.6.3.25334)

number = DoubleInput(10)
number_2 = DoubleInput(50)
number_3 = DoubleInput(x..y, number, number_2, lacing=Longest)
watch = Watch(number_3)
number_4 = DoubleInput(5)
number_5 = DoubleInput(Increment, number_4, lacing=Longest)
number_6 = DoubleInput(x..y..#z, number, number_2, number_5, lacing=Longest)
watch_2 = Watch(number_6)
number_7 = DoubleInput(x..y..~z, number, number_2, number_5, lacing=Longest)
watch_3 = Watch(number_7)
number_8 = DoubleInput(x..y..z, number, number_2, number_5, lacing=Longest)
watch_4 = Watch(number_8)
