# Dynamo graph Dynamo_Nodes_InverseTangent.dyn (Dynamo 0.6.2.29585)

number = DoubleInput(0)
inverse_tangent = Atan(number, lacing=Longest)
number_2 = DoubleInput(0.5)
inverse_tangent_2 = Atan(number_2, lacing=Longest)
number_3 = DoubleInput(1)
inverse_tangent_3 = Atan(number_3, lacing=Longest)
number_4 = DoubleInput(-0.4)
inverse_tangent_4 = Atan(number_4, lacing=Longest)
number_5 = DoubleInput(2)
inverse_tangent_5 = Atan(number_5, lacing=Longest)
