# Dynamo graph Dynamo_Nodes_RemoveFromList.dyn (Dynamo 0.6.2.29585)

number = DoubleInput(5)
number_2 = DoubleInput(1..10)
remove_from_list = RemoveFromList(number, number_2)
number_3 = DoubleInput(2..5)
remove_from_list_2 = RemoveFromList(number_3, number_2)
