# Dynamo graph GroupByKey.dyn (Dynamo 0.9.0.3067)

code_block = CodeBlock { 1..15..3; 1..15..2; }
join = List.Join(code_block.out0, code_block.out1)
groupByKey = GroupByKey(join, join)
sortByKey = SortByKey(join, join)
