# Dynamo graph IsNull_3054.dyn (Dynamo 1.0.1.1743)

number = DoubleInput(0)
isNull = Object.IsNull(number)
string = StringInput("a")
byCoordinates = Point.ByCoordinates(x=string, y=string, z=string, lacing=Longest)
isNull_2 = Object.IsNull(byCoordinates)
