# Dynamo graph LibraryTestCreateFamilyInstance.dyn (Dynamo 0.6.2.14024)

number = DoubleInput(0)
number_2 = DoubleInput(5)
XYZ = Xyz(number, number_2, number_2, lacing=Longest)
select_family_type = FamilyTypeSelector(index=0)
create_family_instance = FamilyInstanceCreatorXyz(XYZ, select_family_type, lacing=Longest)
