# Dynamo graph LibraryTestExcelRead.dyn (Dynamo 1.0.1.1743)

string = StringInput("C:\Excel.xls")
readExcelFile = Excel.ReadExcelFile(string)
string_2 = StringInput("Sheet2")
getExcelWorksheetByName = Excel.GetExcelWorksheetByName(readExcelFile, string_2)
getDataFromExcelWorksheet = Excel.GetDataFromExcelWorksheet(getExcelWorksheetByName)
watch = Watch(getDataFromExcelWorksheet)
getWorksheetsFromExcelWorkbook = Excel.GetWorksheetsFromExcelWorkbook(readExcelFile)
