# Dynamo graph LibraryTestModelCurve.dyn (Dynamo 0.6.2.14024)

number = DoubleInput(0)
XYZ = Xyz(number, number, number, lacing=Longest)
number_2 = DoubleInput(40)
circle = Circle(XYZ, number_2, lacing=Longest)
model_curve = ModelCurve(circle, lacing=Longest)
