# Dynamo graph LibraryTestPythonScript.dyn (Dynamo 1.0.1.1743)

number = DoubleInput(0)
byCoordinates = Point.ByCoordinates(x=number, y=number, z=number, lacing=Longest)
number_2 = DoubleInput(6)
python_script = Python(IN[0]=number_2)
# ---------- python_script.python (28 lines) ----------
# Default imports
import clr
clr.AddReference('RevitAPI')
clr.AddReference('RevitAPIUI')
from Autodesk.Revit.DB import *
import Autodesk
import sys
import clr
path = r'C:\Autodesk\Dynamo\Core'
exec_path = r'C:\Autodesk\Dynamo\Core\dll'
sys.path.append(path)
sys.path.append(exec_path)
clr.AddReference('LibGNet')
from Autodesk.LibG import *

#The input to this node will be stored in the IN[0] variable.
dataEnteringNode = IN[0]

#Processing
OUT = []
x, i = 1, 0
while i < IN[0]:
	x += i
	OUT += [x]
	i += 1

#Assign your output to the OUT variable
OUT = OUT
# ----------------------------------------
byCenterPointRadius = Circle.ByCenterPointRadius(centerPoint=byCoordinates, radius=python_script, lacing=Longest)
