# Dynamo graph LibraryTestReferencePoint.dyn (Dynamo 0.6.2.14024)

number = DoubleInput(2.5)
number_2 = DoubleInput(0..100..#5)
XYZ = Xyz(number, number, number_2, lacing=Longest)
reference_point = ReferencePointByXyz(XYZ, lacing=Longest)
watch = Watch(reference_point)
