# Dynamo graph ProjectPointOnCurve_3041.dyn (Dynamo 1.0.1.1743)

number = DoubleInput(5..6)
byCoordinates = Point.ByCoordinates(x=number)
closestPointTo = Geometry.ClosestPointTo(other=byCoordinates, lacing=Longest)
