# Dynamo graph ProjectPointOnFace_3042.dyn (Dynamo 0.6.3.7993)

number = DoubleInput(5)
XYZ = Xyz(number, number, number, lacing=Longest)
select_face = FormElementBySelection()  # 1 picked in the model
project_point_on_face_or_plane = ProjectPointOnFace(XYZ, select_face, lacing=Longest)
xz_plane = XzPlane(lacing=Longest)
project_point_on_face_or_plane_2 = ProjectPointOnFace(XYZ, xz_plane, lacing=Longest)
watch = Watch(project_point_on_face_or_plane_2.out0)
watch_2 = Watch(project_point_on_face_or_plane_2.out1)
watch_3 = Watch(project_point_on_face_or_plane_2.out2)
watch_4 = Watch(project_point_on_face_or_plane_2.out4)
watch_5 = Watch(project_point_on_face_or_plane_2.out3)
watch_6 = Watch(project_point_on_face_or_plane_2.out5)
