# Dynamo graph ReadImageFile_2649.dyn (Dynamo 0.6.3.7993)

file_path = StringFilename("D:\FromF\DynamoProject\Graphs\MigrationDYN\StandAlone\honey-badger.jpg")
number = DoubleInput(5)
number_2 = DoubleInput(3)
read_image_file = ImageFileReader(file_path, number, number_2)
list_length = Length(read_image_file)
watch = Watch(list_length)
