# Dynamo graph TestAdd.dyn (Dynamo 0.6.2.29585)

number = DoubleInput(2)
number_2 = DoubleInput(5)
add = Addition(number, number_2, lacing=Longest)
number_3 = DoubleInput(-1)
add_2 = Addition(number, number_3, lacing=Longest)
number_4 = DoubleInput(2.5)
add_3 = Addition(number, number_4, lacing=Longest)
