# Dynamo graph TestAddToList.dyn (Dynamo 0.6.3.5265)

number = DoubleInput(0)
number_2 = DoubleInput(1..5)
add_to_list = List(number, number_2)
number_3 = DoubleInput(0.1)
add_to_list_2 = List(number_3, number_2)
string = StringInput("oh")
add_to_list_3 = List(string, number_2)
add_to_list_4 = List(number_2, number_2)
