# Dynamo graph TestAnd.dyn (Dynamo 0.6.2.29585)

boolean = BoolSelector(false)
boolean_2 = BoolSelector(true)
and_ = And(boolean, boolean_2)
and_2 = And(boolean, boolean)
and_3 = And(boolean_2, boolean_2)
