# Dynamo graph TestAnd_NumberInput.dyn (Dynamo 0.6.2.29585)

number = DoubleInput(0)
number_2 = DoubleInput(5)
and_ = And(number, number_2)
and_2 = And(number, number)
and_3 = And(number_2, number_2)
