# Dynamo graph TestAverage.dyn (Dynamo 0.6.2.29585)

number = DoubleInput(1..10)
average = Average(number, lacing=Longest)
number_2 = DoubleInput(0.5..10.5..1)
average_2 = Average(number_2, lacing=Longest)
number_3 = DoubleInput(-10..-1)
average_3 = Average(number_3, lacing=Longest)
number_4 = DoubleInput(5)
average_4 = Average(number_4, lacing=Longest)
