# Dynamo graph TestCeiling.dyn (Dynamo 1.0.1.1743)

number = DoubleInput(3)
ceiling = Math.Ceiling(number, lacing=Longest)
number_2 = DoubleInput(-2)
ceiling_2 = Math.Ceiling(number_2, lacing=Longest)
number_3 = DoubleInput(2.5)
ceiling_3 = Math.Ceiling(number_3, lacing=Longest)
number_4 = DoubleInput(2.3)
ceiling_4 = Math.Ceiling(number_4, lacing=Longest)
number_5 = DoubleInput(2.8)
ceiling_5 = Math.Ceiling(number_5, lacing=Longest)
number_6 = DoubleInput(-2.8)
ceiling_6 = Math.Ceiling(number_6, lacing=Longest)
