# Dynamo graph TestCompose.dyn (Dynamo 0.6.2.29585)

number = DoubleInput(1)
add = Addition(number, lacing=Longest)
number_2 = DoubleInput(2)
add_2 = Addition(arg1=number_2, lacing=Longest)
compose_functions = ComposeFunctions(add, add_2)
number_3 = DoubleInput(3)
apply_function = Apply1(arg1=compose_functions, number_3)
watch = Watch(apply_function)
