# Dynamo graph TestCosine.dyn (Dynamo 0.6.2.29585)

number = DoubleInput(0)
cosine = Cos(number, lacing=Longest)
number_2 = DoubleInput(3)
cosine_2 = Cos(number_2, lacing=Longest)
number_3 = DoubleInput(-5)
cosine_3 = Cos(number_3, lacing=Longest)
number_4 = DoubleInput(18.12)
cosine_4 = Cos(number_4, lacing=Longest)
