# Dynamo graph TestDropEveryNth.dyn (Dynamo 1.0.1.1743)

number = DoubleInput(1..10)
number_2 = DoubleInput(3)
number_3 = DoubleInput(1)
dropEveryNthItem = List.DropEveryNthItem(list=number, n=number_2, offset=number_3)
