# Dynamo graph TestDropEveryNth_ListOfListAsInput.dyn (Dynamo 1.0.1.1743)

number = DoubleInput(1..2)
create_list = List.Create(number, number, number, number, number, number)
number_2 = DoubleInput(3)
number_3 = DoubleInput(1)
dropEveryNthItem = List.DropEveryNthItem(list=create_list, n=number_2, offset=number_3)
