# Dynamo graph TestEqual.dyn (Dynamo 0.6.2.29585)

number = DoubleInput(2)
number_2 = DoubleInput(8)
equal = Equal(number, number_2)
equal_2 = Equal(number_2, number_2)
number_3 = DoubleInput(2)
equal_3 = Equal(number, number_3)
