# Dynamo graph TestFirstOfList.dyn (Dynamo 1.0.1.1743)

number = DoubleInput(1..10)
firstItem = List.FirstItem(number)
empty = List.Empty()
firstItem_2 = List.FirstItem(empty)
number_2 = DoubleInput(1)
firstItem_3 = List.FirstItem(number_2)
