# Dynamo graph TestFloor.dyn (Dynamo 0.6.2.29585)

number = DoubleInput(3)
floor = Floor(number, lacing=Longest)
number_2 = DoubleInput(-2)
floor_2 = Floor(number_2, lacing=Longest)
number_3 = DoubleInput(2.5)
floor_3 = Floor(number_3, lacing=Longest)
number_4 = DoubleInput(2.3)
floor_4 = Floor(number_4, lacing=Longest)
number_5 = DoubleInput(2.8)
floor_5 = Floor(number_5, lacing=Longest)
number_6 = DoubleInput(-2.1)
floor_6 = Floor(number_6, lacing=Longest)
