# Dynamo graph TestGreaterThan.dyn (Dynamo 1.0.1.1743)

number = DoubleInput(2)
number_2 = DoubleInput(8)
greaterThan = Compare.GreaterThan(number, number_2)
greaterThan_2 = Compare.GreaterThan(number_2, number)
greaterThan_3 = Compare.GreaterThan(number_2, number_2)
