# Dynamo graph TestGreaterThanOrEqual.dyn (Dynamo 1.0.1.1743)

number = DoubleInput(2)
number_2 = DoubleInput(8)
greaterThanOrEqual = Compare.GreaterThanOrEqual(number, number_2)
greaterThanOrEqual_2 = Compare.GreaterThanOrEqual(number_2, number)
greaterThanOrEqual_3 = Compare.GreaterThanOrEqual(number_2, number_2)
