# Dynamo graph TestIf.dyn (Dynamo 1.0.1.1743)

boolean = BoolSelector(false)
number = DoubleInput(2)
number_2 = DoubleInput(3)
if_ = If(test=boolean, true=number, false=number_2)
boolean_2 = BoolSelector(true)
if_2 = If(test=boolean_2, true=number, false=number_2)
