# Dynamo graph TestInverseCosine.dyn (Dynamo 1.0.1.1743)

number = DoubleInput(0)
acos = Math.Acos(number)
degreesToRadians = Math.DegreesToRadians(acos, lacing=Longest)
number_2 = DoubleInput(0.5)
acos_2 = Math.Acos(number_2)
degreesToRadians_2 = Math.DegreesToRadians(acos_2, lacing=Longest)
number_3 = DoubleInput(1)
acos_3 = Math.Acos(number_3)
degreesToRadians_3 = Math.DegreesToRadians(acos_3, lacing=Longest)
number_4 = DoubleInput(-0.4)
acos_4 = Math.Acos(number_4)
degreesToRadians_4 = Math.DegreesToRadians(acos_4, lacing=Longest)
number_5 = DoubleInput(2)
acos_5 = Math.Acos(number_5)
degreesToRadians_5 = Math.DegreesToRadians(acos_5, lacing=Longest)
