# Dynamo graph TestInverseSine.dyn (Dynamo 1.0.1.1743)

number = DoubleInput(0)
asin = Math.Asin(number)
degreesToRadians = Math.DegreesToRadians(asin, lacing=Longest)
number_2 = DoubleInput(0.5)
asin_2 = Math.Asin(number_2)
degreesToRadians_2 = Math.DegreesToRadians(asin_2, lacing=Longest)
number_3 = DoubleInput(1)
asin_3 = Math.Asin(number_3)
degreesToRadians_3 = Math.DegreesToRadians(asin_3, lacing=Longest)
number_4 = DoubleInput(-0.4)
asin_4 = Math.Asin(number_4)
degreesToRadians_4 = Math.DegreesToRadians(asin_4, lacing=Longest)
number_5 = DoubleInput(2)
asin_5 = Math.Asin(number_5)
degreesToRadians_5 = Math.DegreesToRadians(asin_5, lacing=Longest)
