# Dynamo graph TestInverseTangent.dyn (Dynamo 1.0.1.1743)

number = DoubleInput(0)
atan = Math.Atan(number)
degreesToRadians = Math.DegreesToRadians(atan, lacing=Longest)
number_2 = DoubleInput(0.5)
atan_2 = Math.Atan(number_2)
degreesToRadians_2 = Math.DegreesToRadians(atan_2, lacing=Longest)
number_3 = DoubleInput(1)
atan_3 = Math.Atan(number_3)
degreesToRadians_3 = Math.DegreesToRadians(atan_3, lacing=Longest)
number_4 = DoubleInput(-0.4)
atan_4 = Math.Atan(number_4)
degreesToRadians_4 = Math.DegreesToRadians(atan_4, lacing=Longest)
number_5 = DoubleInput(2)
atan_5 = Math.Atan(number_5)
degreesToRadians_5 = Math.DegreesToRadians(atan_5, lacing=Longest)
