# Dynamo graph TestIsEmptyList.dyn (Dynamo 0.6.3.5265)

number = DoubleInput(0)
is_empty_list = IsEmpty(number)
number_2 = DoubleInput(1..5)
is_empty_list_2 = IsEmpty(number_2)
string = StringInput("oh")
is_empty_list_3 = IsEmpty(string)
empty_list = Empty()
is_empty_list_4 = IsEmpty(empty_list)
