# Dynamo graph TestLessThan.dyn (Dynamo 1.0.1.1743)

number = DoubleInput(2)
number_2 = DoubleInput(8)
lessThan = Compare.LessThan(number, number_2)
lessThan_2 = Compare.LessThan(number_2, number)
lessThan_3 = Compare.LessThan(number_2, number_2)
