# Dynamo graph TestLessThan1.dyn (Dynamo 1.0.1.1743)

code_block = CodeBlock { 2; }
code_block_2 = CodeBlock { 8; }
lt = code_block < code_block_2
lt_2 = code_block_2 < code_block
lt_3 = code_block_2 < code_block_2
