# Dynamo graph TestLessThanOrEqual.dyn (Dynamo 1.0.1.1743)

number = DoubleInput(8)
lessThanOrEqual = Compare.LessThanOrEqual(number, number)
number_2 = DoubleInput(2)
lessThanOrEqual_2 = Compare.LessThanOrEqual(number_2, number)
lessThanOrEqual_3 = Compare.LessThanOrEqual(number, number_2)
