# Dynamo graph TestListCreate.dyn (Dynamo 0.6.3.5265)

list = NewList()
number = DoubleInput(1)
number_2 = DoubleInput(-1.5)
list_2 = NewList(index0=number, index1=number_2, index2=number_2)
string = StringInput("Hi,")
string_2 = StringInput("I am")
string_3 = StringInput("a test")
list_3 = NewList(index0=string, index1=string_2, index2=string_3)
number_3 = DoubleInput(1..10)
list_4 = NewList(index0=number_3)
list_5 = NewList(index0=number, index1=string)
list_6 = NewList(index0=number_3, index1=number)
