# Dynamo graph TestListCreate1.dyn (Dynamo 0.7.0.20258)

create_list = List.Create()
code_block = CodeBlock { 1; }
code_block_2 = CodeBlock { -1.5; }
create_list_2 = List.Create(code_block, code_block_2, code_block_2)
code_block_3 = CodeBlock { "\"Hi,\""; }
code_block_4 = CodeBlock { "\"I am\""; }
code_block_5 = CodeBlock { "\"a test\""; }
create_list_3 = List.Create(code_block_3, code_block_4, code_block_5)
code_block_6 = CodeBlock { 1..10; }
create_list_4 = List.Create(code_block_6)
create_list_5 = List.Create(code_block, code_block_3)
