# Dynamo graph TestListFlatten.dyn (Dynamo 2.0.0.4740)

code_block = CodeBlock { {1,3,5,{2,4,{6},8},7,9,{{0}}}; }
flatten = List.Flatten(code_block)
code_block_2 = CodeBlock { 1; }
flatten_2 = List.Flatten(list=code_block, amt=code_block_2)
