# Dynamo graph TestListLength.dyn (Dynamo 0.6.3.5265)

number = DoubleInput(0)
list_length = Length(number)
number_2 = DoubleInput(1..10)
list_length_2 = Length(number_2)
empty_list = Empty()
list_length_3 = Length(empty_list)
