# Dynamo graph TestMigrateBuiltIn.dyn (Dynamo 1.3.0.961)

code_block = CodeBlock { {1,2,3,4,true, 32, false, 234}; }
code_block_2 = CodeBlock { "int"; }
removeIfNot = RemoveIfNot(code_block, code_block_2)
byCoordinates = Point.ByCoordinates()
byCoordinates_2 = Point.ByCoordinates()
equals = Equals(byCoordinates, byCoordinates_2)
code_block_3 = CodeBlock { 10; }
ge = code_block_3 >= _  # unwired: arg1
groupByFunction = GroupByFunction(code_block, ge)
code_block_4 = CodeBlock { a={}; a["foo"]=1; a["bar"]=2; a[3]=3; }
code_block_5 = CodeBlock { "foo"; }
containsKey = ContainsKey(code_block_4.a, code_block_5)
sortByFunction = SortByFunction(code_block, ge)
maximumItemByKey = MaximumItemByKey(code_block_4.a, ge)
minimumItemByKey = MinimumItemByKey(code_block_4.a, ge)
trueForAll = TrueForAll(code_block, ge)
trueForAny = TrueForAny(code_block, ge)
removeKey = RemoveKey(code_block_4.a, code_block_5)
getKeys = GetKeys(code_block_4.a)
getValues = GetValues(code_block_4.a)
