# Dynamo graph TestMigrationFFIClass.dyn (Dynamo 2.11.0.3706)

byNothing = FFITarget.ClassWithMigratedMembers.ByNothing()
code_block = CodeBlock { "hello"; "world"; }
AMemberWithAChangedName2 = FFITarget.ClassWithMigratedMembers.AMemberWithAChangedName1(classWithMigratedMembers=byNothing, a=code_block.out0)  # "ClassWithMigratedMembers.AMemberWithAChangedName2"
hello = Watch(AMemberWithAChangedName2)
AMemberWithTwoParams = FFITarget.ClassWithMigratedMembers.AMemberWithTwoParams(classWithMigratedMembers=byNothing, a=code_block.out0, b=code_block.out1)
helloworld = Watch(AMemberWithTwoParams)
anOverloadedMember = FFITarget.ClassWithMigratedMembers.AnOverloadedMember(classWithMigratedMembers=byNothing, a=code_block.out0, b=code_block.out1)
overload = Watch(anOverloadedMember)
