# Dynamo graph TestMigration_ColorRange.dyn (Dynamo 2.0.0.4621)

code_block = CodeBlock { 255; }
byARGB = Color.ByARGB(r=code_block)
byARGB_2 = Color.ByARGB(g=code_block)
create = List.Create(byARGB, byARGB_2)
code_block_2 = CodeBlock { 0..1..#6; }
byCoordinates = UV.ByCoordinates(code_block_2, code_block_2)
byColorsAndParameters = ColorRange2D.ByColorsAndParameters(create, byCoordinates)
getColorAtParameter = ColorRange2D.GetColorAtParameter(byColorsAndParameters, byCoordinates)
