# Dynamo graph TestMigration_Core_Input.dyn (Dynamo 1.0.1.1743)

number = DoubleInput(0)
degreesToRadians = Math.DegreesToRadians(number)
area_from_string = AreaFromString(0)
area = DynamoUnits.Area.FromDouble(lacing=Longest)
boolean = BoolSelector(false)
directory_path = Directory("No file selected.")
file_path = Filename("No file selected.")
integer_slider = IntegerSlider(50, range=0..100 step 1)
length_from_string = LengthFromString(0)
length = DynamoUnits.Length.FromDouble(lacing=Longest)
number_2 = DoubleInput(0)
number_slider = DoubleSlider(50, range=0..100 step 0.1)
string = StringInput("")
volume_from_string = VolumeFromString(0)
volume = DynamoUnits.Volume.FromDouble(lacing=Longest)
isNull = Object.IsNull()
