# Dynamo graph TestMigration_Core_List.dyn (Dynamo 1.0.1.1743)

code_block = CodeBlock { {}; }
sublists = List.Sublists(ranges=code_block)
empty = List.Empty()
create_list = List.Create()
range = Range(lacing=Longest)
sequence = Sequence(lacing=Longest)
ofRepeatedItem = List.OfRepeatedItem()
cartesianProduct = List.CartesianProduct()
combine = List.Combine()
filter = Filter()
filterByBoolMask = List.FilterByBoolMask()
filter_2 = Filter()
filter_3 = Filter()
longest = LaceLongest()  # "List.Longest"
laceShortest = List.LaceShortest()
map = List.Map()
reduce = Reduce()
addItemToFront = List.AddItemToFront()
diagonalLeft = List.DiagonalLeft()
diagonalRight = List.DiagonalRight()
dropEveryNthItem = List.DropEveryNthItem()
dropItems = List.DropItems()
flatten = List.Flatten()
flatten_2 = Flatten()
groupByFunction = GroupByFunction()
join = List.Join()
chop = List.Chop()
removeItemAtIndex = List.RemoveItemAtIndex()
reverse = List.Reverse()
shiftIndices = List.ShiftIndices()
shuffle = List.Shuffle()
add = _ + _
slice = List.Slice(arg2=add)
sort = List.Sort()
sort_2 = List.Sort()
deconstruct = List.Deconstruct()
takeEveryNthItem = List.TakeEveryNthItem()
takeItems = List.TakeItems()
transpose = List.Transpose()
average = Math.Average(lacing=Longest)
firstItem = List.FirstItem()
getItemAtIndex = List.GetItemAtIndex()
isEmpty = List.IsEmpty()
lastItem = List.LastItem()
count = List.Count()
maximumItem = List.MaximumItem()
minimumItem = List.MinimumItem()
restOfItems = List.RestOfItems()
trueForAll = TrueForAll()
trueForAny = TrueForAny()
