# Dynamo graph TestMigration_Core_Strings.dyn (Dynamo 4.1.0.3107)

concat = String.Concat()  # unwired: string0, string1
join = String.Join()  # unwired: separator, string0
code_block = CodeBlock { 0; }
getItemAtIndex = List.GetItemAtIndex(list=join, index=code_block)
split = String.Split()  # unwired: string, separator0
changeCase = String.ChangeCase()  # unwired: string, upper
length = String.Length()  # unwired: string
toNumber = String.ToNumber(lacing=Longest)  # unwired: string
substring = String.Substring()  # unwired: string, startIndex, length
