# Dynamo graph TestMigration_DSCoreNodesUI_to_CoreNodeModels.dyn (Dynamo 0.9.1.3574)

number_slider = DoubleSlider(11.5, range=0..100 step 0.1)
integer_slider = IntegerSlider(15, range=0..100 step 1)
string = StringInput("lalala")
create = List.Create(number_slider, integer_slider, string)
string_from_object = FromObject(string)
