# Dynamo graph TestMigration_DSCore_Display_ByGeometryColor.dyn (Dynamo 0.8.1.1823)

code_block = CodeBlock { 10; 255; 0; }
byLengths = Cuboid.ByLengths(width=code_block.out0, length=code_block.out0, height=code_block.out0)
byARGB = Color.ByARGB(a=code_block.out1, r=code_block.out1, g=code_block.out2, b=code_block.out2)
byGeometryColor = Display.ByGeometryColor(byLengths, byARGB)
