# Dynamo graph TestMigration_Display_BySurfaceColors.dyn (Dynamo 2.0.0.4611)

code_block = CodeBlock { 10; 255; 0; }
byLengths = Cuboid.ByLengths(width=code_block.out0, length=code_block.out0)
faces = Topology.Faces(byLengths)
code_block_2 = CodeBlock(a=faces) { a[0]; }
surfaceGeometry = Face.SurfaceGeometry(code_block_2)
bySurfaceColors = Display.Display.BySurfaceColors(surfaceGeometry)
byARGB = Color.ByARGB(a=code_block.out1, r=code_block.out1, g=code_block.out2, b=code_block.out2)
byARGB_2 = Color.ByARGB(a=code_block.out1, r=code_block.out2, g=code_block.out2, b=code_block.out1)
code_block_3 = CodeBlock(a=byARGB, b=byARGB_2) { {a,b}; }
