# Dynamo graph TestMigration_FunctionApplyAndCompose.dyn (Dynamo 0.9.1.4062)

code_block = CodeBlock { 2; }
add = _ + code_block
mul = _ * code_block
compose = ComposeFunctions(add, mul)  # "Function.Compose"
code_block_2 = CodeBlock { 5; }
apply = ApplyFunction(compose, code_block_2)  # "Function.Apply"
