# Dynamo graph TestMigration_Logic_Math.dyn (Dynamo 1.0.1.1743)

add = _ + _  # lacing=Longest
div = _ / _  # lacing=Longest
formula = Formula("\n      ", lacing=Longest)
mod = _ % _  # lacing=Longest
mul = _ * _  # lacing=Longest
pow = Math.Pow(lacing=Longest)
sub = _ - _  # lacing=Longest
piTimes2 = Math.PiTimes2()
E = Math.E()
PI = Math.PI()
rand = Math.Rand()
random = Math.Random(lacing=Longest)
randomList = Math.RandomList()
ceiling = Math.Ceiling(lacing=Longest)
floor = Math.Floor(lacing=Longest)
round = Math.Round(lacing=Longest)
radiansToDegrees = Math.RadiansToDegrees()
cos = Math.Cos(radiansToDegrees, lacing=Longest)
acos = Math.Acos()
degreesToRadians = Math.DegreesToRadians(acos, lacing=Longest)
asin = Math.Asin()
degreesToRadians_2 = Math.DegreesToRadians(asin, lacing=Longest)
atan = Math.Atan()
degreesToRadians_3 = Math.DegreesToRadians(atan, lacing=Longest)
radiansToDegrees_2 = Math.RadiansToDegrees()
sin = Math.Sin(radiansToDegrees_2, lacing=Longest)
radiansToDegrees_3 = Math.RadiansToDegrees()
tan = Math.Tan(radiansToDegrees_3, lacing=Longest)
