# Dynamo graph TestMigration_Watch3D.dyn (Dynamo 0.9.0.0)

code_block = CodeBlock { 2; }
byLengths = Cuboid.ByLengths(width=code_block, length=code_block, height=code_block)
watch_3d = Watch3D(byLengths)
