# Dynamo graph TestModulo.dyn (Dynamo 1.0.1.1743)

number = DoubleInput(3)
number_2 = DoubleInput(5)
mod = number % number_2  # lacing=Longest
number_3 = DoubleInput(-2)
mod_2 = number % number_3  # lacing=Longest
number_4 = DoubleInput(2.5)
mod_3 = number % number_4  # lacing=Longest
number_5 = DoubleInput(10)
mod_4 = number_5 % number  # lacing=Longest
