# Dynamo graph TestMultiply.dyn (Dynamo 0.6.2.29585)

number = DoubleInput(2)
number_2 = DoubleInput(5)
multiply = Multiplication(number, number_2, lacing=Longest)
number_3 = DoubleInput(-1)
multiply_2 = Multiplication(number, number_3, lacing=Longest)
number_4 = DoubleInput(2.5)
multiply_3 = Multiplication(number, number_4, lacing=Longest)
