# Dynamo graph TestMultiplydyn.dyn (Dynamo 1.0.1.1743)

number = DoubleInput(2)
number_2 = DoubleInput(5)
div = number / number_2  # lacing=Longest
number_3 = DoubleInput(-1)
div_2 = number / number_3  # lacing=Longest
number_4 = DoubleInput(2.5)
div_3 = number / number_4  # lacing=Longest
number_5 = DoubleInput(0)
div_4 = number_5 / number  # lacing=Longest
div_5 = number / number_5  # lacing=Longest
