# Dynamo graph TestNewList.dyn (Dynamo 0.6.2.29585)

number = DoubleInput(1)
number_2 = DoubleInput(-1)
number_3 = DoubleInput(2.5)
list = NewList(index0=number, index1=number, index2=number_2, index3=number_3)
string = StringInput("hi,")
string_2 = StringInput("I am")
string_3 = StringInput("test")
list_2 = NewList(index0=string, index1=string_2, index2=number, index3=string_3)
number_4 = DoubleInput(1..3)
list_3 = NewList(index0=number_4, index1=number, index2=number, index3=number)
