# Dynamo graph TestNumberRange.dyn (Dynamo 0.8.2.2173)

number = DoubleInput(1)
number_2 = DoubleInput(5)
number_3 = DoubleInput(1)
number_range = NumberRange(number, number_2, number_3, lacing=Longest)
