# Dynamo graph TestNumberSequence.dyn (Dynamo 0.8.2.2564)

code_block = CodeBlock { 2; }
code_block_2 = CodeBlock { 3; }
code_block_3 = CodeBlock { 2; }
number_sequence = NumberSeq(code_block, code_block_2, code_block_3, lacing=Longest)
