# Dynamo graph TestOverall00.dyn (Dynamo 0.6.2.29585)

apply_function = Apply1()
apply_function_to_list = ApplyList()
debug_breakpoint = Breakpoint()
perform_all = Begin()
compose_functions = ComposeFunctions()
create_thunk = Thunk()
future = Future(lacing=Longest)
now = Now(lacing=Longest)
angle = AngleInput(0)
boolean = BoolSelector(false)
directory = StringDirectory("No file selected.")
file_path = StringFilename("No file selected.")
identity = Identity()
integer_slider = IntegerSliderInput(50, range=0..100)
number = DoubleInput(0)
number_slider = DoubleSliderInput(50, range=0..100)
string = StringInput("")
build_sublists = Sublists("", lacing=Longest)
empty_list = Empty()
list = NewList()
number_range = NumberRange(lacing=Longest)
number_sequence = NumberSeq(lacing=Longest)
repeat = Repeat(lacing=Longest)
average = Average(lacing=Longest)
first_of_list = First()
get_from_list = GetFromList()
is_empty_list = IsEmpty()
list_length = Length()
list_maximum = ListMax()
list_minimum = ListMin()
rest_of_list = Rest()
smooth = Smooth(lacing=Longest)
true_for_all = AndMap()
true_for_any = OrMap()
python_script = Python()
# ---------- python_script.python (15 lines) ----------
# Default imports
import sys
import clr
path = r'C:\Autodesk\Dynamo\Core'
exec_path = r'C:\Autodesk\Dynamo\Core\dll'
sys.path.append(path)
sys.path.append(exec_path)
clr.AddReference('LibGNet')
from Autodesk.LibG import *

#The input to this node will be stored in the IN variable.
dataEnteringNode = IN

#Assign your output to the OUT variable
OUT = 0
# ----------------------------------------
python_script_from_string = PythonString()
python_script_with_variable = Python()  # "Python Script With Variable Number of Inputs"
# ---------- python_script_with_variable.python (15 lines) ----------
# Default imports
import sys
import clr
path = r'C:\Autodesk\Dynamo\Core'
exec_path = r'C:\Autodesk\Dynamo\Core\dll'
sys.path.append(path)
sys.path.append(exec_path)
clr.AddReference('LibGNet')
from Autodesk.LibG import *

#The input to this node will be stored in the IN0...INX variable(s).
dataEnteringNode = IN0

#Assign your output to the OUT variable
OUT = 0
# ----------------------------------------
concat_strings = ConcatStrings()
join_strings = JoinStrings()
number_to_string = Num2String(lacing=Longest)
split_string = SplitString()
string_case = StringCase()
string_length = StringLen()
string_to_number = String2Num(lacing=Longest)
substring = Substring()
to_string = ToString()
dateTime = MakeDateTime(lacing=Longest)
execution_interval = ExecuteInterval()
pause = Pause()
watch = Watch()
watch_3d = Watch3D()
equal = Equal()
greater_than = GreaterThan()
greater_than_or_equal = GreaterThanEquals()
less_than = LessThan()
less_than_or_equal = LessThanEquals()
and_ = And()
if_ = Conditional()
not_ = Not()
or_ = Or()
xor = Xor()
add = Addition(lacing=Longest)
divide = Division(lacing=Longest)
formula = Formula("\n      ", lacing=Longest)
modulo = Modulo(lacing=Longest)
multiply = Multiplication(lacing=Longest)
power = Pow(lacing=Longest)
subtract = Subtraction(lacing=Longest)
n2_pi = PiTimes2()  # "2*Pi"
e = EConstant()
pi = Pi()
find_root = NewtonRootFind1DNoDeriv()
find_root_with_derivative = NewtonRootFind1DWithDeriv()
random_number = Random()
random_number_by_seed = RandomSeed(lacing=Longest)
random_number_list = RandomList()
ceiling = Ceiling(lacing=Longest)
floor = Floor(lacing=Longest)
round = Round(lacing=Longest)
cosine = Cos(lacing=Longest)
inverse_cosine = Acos(lacing=Longest)
inverse_sine = Asin(lacing=Longest)
inverse_tangent = Atan(lacing=Longest)
sine = Sin(lacing=Longest)
tangent = Tan(lacing=Longest)
BSplineCurve = BSplineCurveNode(lacing=Longest)
circle_libg = CircleNode(lacing=Longest)
closed_bsplinecurve = ClosedBSplineCurveNode(lacing=Longest)
length_libg = LengthNode(lacing=Longest)
line_libg = LineNode(lacing=Longest)
normal_at_parameter = NormalAtParameterNode(lacing=Longest)
point_at_distance = PointAtDistanceNode(lacing=Longest)
point_at_parameter = PointAtParameterNode(lacing=Longest)
polygon = PolygonNode(lacing=Longest)
intersect = IntersectNode(lacing=Longest)
translate = TranslateNode(lacing=Longest)
trim = TrimNode(lacing=Longest)
coordinateSystem = CoordinateSystemNode(lacing=Longest)
point = Point3DNode(lacing=Longest)
point_2d = Point2DNode(lacing=Longest)
point_x = PointXNode(lacing=Longest)
point_y = PointYNode(lacing=Longest)
point_z = PointZNode(lacing=Longest)
vector = VectorNode(lacing=Longest)
vector_x = VectorXNode(lacing=Longest)
vector_y = VectorYNode(lacing=Longest)
vector_z = VectorZNode(lacing=Longest)
cuboid = CuboidNode(lacing=Longest)
sweep_as_solid = SweepAsSolidNode(lacing=Longest)
thicken_surface = ThickenSurfaceNode(lacing=Longest)
area = AreaNode(lacing=Longest)
extrude_curve = ExtrudeNode(lacing=Longest)
loft = LoftNode(lacing=Longest)
normal_at_uv_parameter = NormalAtUvParameterNode(lacing=Longest)
patch = PatchNode(lacing=Longest)
plane_libg = PlaneNode(lacing=Longest)
point_at_uv_parameter = PointAtUvParameterNode(lacing=Longest)
sweep_as_surface = SweepAsSurfaceNode(lacing=Longest)
draw = ForceDrawNode(lacing=Longest)
export_to_sat = ExportSATNode(lacing=Longest)
import_sat = ImportSATNode(lacing=Longest)
domain = Domain()
color = Color(lacing=Longest)
color_brightness = ColorBrightness(lacing=Longest)
color_components = ColorComponents(lacing=Longest)
color_hue = ColorHue(lacing=Longest)
color_saturation = ColorSaturation(lacing=Longest)
daylighting_environment = MakeDaylightingEnvironmentData(lacing=Longest)
daylighting_skymodel = MakeDaylightingSkyModel(lacing=Longest)
get_daylighting_grid_colors = GetDaylightingColors(lacing=Longest)
get_daylighting_grid_illuminance = GetDaylightingIlluminanceValues(lacing=Longest)  # "Get Daylighting Grid Illuminance Values"
get_daylighting_grid_image = GetDaylightingForegroundImage(lacing=Longest)
get_daylighting_grid_normals = GetDaylightingNormals(lacing=Longest)
get_daylighting_grid_positions = GetDaylightingPositions(lacing=Longest)
get_daylighting_grid_resolution = GetSDFResolution(lacing=Longest)
parse_daylighting_file = ParseSDF(lacing=Longest)
cloud_daylighting_job = CloudDaylightingJob(lacing=Longest)
cloud_render = CloudRender()
cloud_rendering_job = CloudRenderingJob(lacing=Longest)
render_quality = RenderQuality(index=0)
render_type = RenderType(index=0)
skymodel_type = SkymodelType(index=0)
upload_render_data = UploadRenderData()
read_image_file = ImageFileReader()
read_text_file = FileReader()
reset_file_watch = FileWatcherReset()
watch_file = FileWatcher()
watched_file_changed = FileWatcherChanged()
watched_file_wait = FileWatcherWait()
write_csv_file = ListToCsv()
write_file = FileWriter()
write_image_file = ImageFileWriter()
arduino = Arduino(COM4)
read_arduino = ArduinoRead()
udp_listener = UdpListener()
web_request = WebRequest()
write_arduino = ArduinoWrite()
add_excel_worksheet_to_workbook = AddExcelWorksheetToWorkbook()
get_data_from_excel_worksheet = GetDataFromExcelWorksheet()
get_excel_worksheet_by_name = GetExcelWorksheetByName()
get_worksheets_from_excel = GetWorksheetsFromExcelWorkbook()
new_excel_workbook = NewExcelWorkbook()
open_excel_workbook = ReadExcelFile()
save_excel_workbook_as = SaveAsExcelWorkbook()
write_data_to_excel_worksheet = WriteDataToExcelWorksheet()
