# Dynamo graph TestPower.dyn (Dynamo 1.0.1.1743)

number = DoubleInput(3)
number_2 = DoubleInput(5)
pow = Math.Pow(number=number, power=number_2, lacing=Longest)
number_3 = DoubleInput(-2)
pow_2 = Math.Pow(number=number, power=number_3, lacing=Longest)
pow_3 = Math.Pow(number=number_3, power=number_2, lacing=Longest)
number_4 = DoubleInput(2.5)
pow_4 = Math.Pow(number=number, power=number_4, lacing=Longest)
