# Dynamo graph TestRandomSeed.dyn (Dynamo 0.6.2.29585)

number = DoubleInput(1)
random_number_by_seed = RandomSeed(number, lacing=Longest)
number_2 = DoubleInput(1.5)
random_number_by_seed_2 = RandomSeed(number_2, lacing=Longest)
