# Dynamo graph TestRectangleByWidthHeight.dyn (Dynamo 0.8.1.1521)

YZ = Plane.YZ()
byWidthHeight = Rectangle.ByWidthHeight(YZ)
watch_3d = Watch3D(byWidthHeight)
byWidthHeight_2 = Rectangle.ByWidthHeight()
watch_3d_2 = Watch3D(byWidthHeight_2)
byWidthHeight_3 = Rectangle.ByWidthHeight()
watch_3d_3 = Watch3D(byWidthHeight_3)
