# Dynamo graph TestRemoveFromList.dyn (Dynamo 1.0.1.1743)

number = DoubleInput(1..10)
number_2 = DoubleInput(5)
removeItemAtIndex = List.RemoveItemAtIndex(list=number, indices=number_2)
number_3 = DoubleInput(2..5)
removeItemAtIndex_2 = List.RemoveItemAtIndex(list=number, indices=number_3)
