# Dynamo graph TestRemoveFromList_ListOfListAsInput.dyn (Dynamo 1.0.1.1743)

number = DoubleInput(1..2)
create_list = List.Create(number, number, number, number)
number_2 = DoubleInput(2)
removeItemAtIndex = List.RemoveItemAtIndex(list=create_list, indices=number_2)
