# Dynamo graph TestRound.dyn (Dynamo 1.0.1.1743)

number = DoubleInput(3)
round = Math.Round(number, lacing=Longest)
number_2 = DoubleInput(-2)
round_2 = Math.Round(number_2, lacing=Longest)
number_3 = DoubleInput(2.5)
round_3 = Math.Round(number_3, lacing=Longest)
number_4 = DoubleInput(2.3)
round_4 = Math.Round(number_4, lacing=Longest)
number_5 = DoubleInput(2.8)
round_5 = Math.Round(number_5, lacing=Longest)
