# Dynamo graph TestSaveDontCorruptForUnresolvedNodes.dyn (Dynamo 0.7.0.28327)

byFaceAndUVDivisions = DividedSurface.ByFaceAndUVDivisions()
byElement = CurtainPanel.ByElement()
element_types = ElementTypes(index=9)
watch = Watch(element_types)
