# Dynamo graph TestSine.dyn (Dynamo 1.0.1.1743)

number = DoubleInput(0)
radiansToDegrees = Math.RadiansToDegrees(number)
sin = Math.Sin(radiansToDegrees, lacing=Longest)
number_2 = DoubleInput(3)
radiansToDegrees_2 = Math.RadiansToDegrees(number_2)
sin_2 = Math.Sin(radiansToDegrees_2, lacing=Longest)
number_3 = DoubleInput(-5)
radiansToDegrees_3 = Math.RadiansToDegrees(number_3)
sin_3 = Math.Sin(radiansToDegrees_3, lacing=Longest)
number_4 = DoubleInput(18.12)
radiansToDegrees_4 = Math.RadiansToDegrees(number_4)
sin_4 = Math.Sin(radiansToDegrees_4, lacing=Longest)
