# Dynamo graph TestSliceList.dyn (Dynamo 0.6.2.29585)

number = DoubleInput(5)
number_2 = DoubleInput(1)
number_3 = DoubleInput(1..10)
slice_list = SliceList(number, number_2, number_3)
number_4 = DoubleInput(3)
slice_list_2 = SliceList(number, number_4, number_3)
