# Dynamo graph TestSliceList_ListOfListAsInput.dyn (Dynamo 0.6.2.29585)

number = DoubleInput(0)
number_2 = DoubleInput(2)
number_3 = DoubleInput(1..2)
list = NewList(index0=number_3, index1=number_3, index2=number_3, index3=number_3)
slice_list = SliceList(number, number_2, list)
