# Dynamo graph TestSort.dyn (Dynamo 0.6.2.29585)

number = DoubleInput(2)
number_2 = DoubleInput(2.5)
number_3 = DoubleInput(-7)
number_4 = DoubleInput(2)
number_5 = DoubleInput(9)
number_6 = DoubleInput(0)
list = NewList(index0=number, index1=number_2, index2=number_3, index3=number_4, index4=number_5, index5=number_6)
sort = Sort(list)
