# Dynamo graph TestSortByKey.dyn (Dynamo 0.6.2.29585)

number = DoubleInput(0)
greater_than = GreaterThan(number)
number_2 = DoubleInput(2)
number_3 = DoubleInput(2.5)
number_4 = DoubleInput(-7)
number_5 = DoubleInput(2)
number_6 = DoubleInput(9)
number_7 = DoubleInput(0)
list = NewList(index0=number_2, index1=number_3, index2=number_4, index3=number_5, index4=number_6, index5=number_7)
sort_by_key = SortBy(greater_than, list)
