# Dynamo graph TestSubtract.dyn (Dynamo 0.6.2.29585)

number = DoubleInput(2)
number_2 = DoubleInput(5)
subtract = Subtraction(number, number_2, lacing=Longest)
number_3 = DoubleInput(-1)
subtract_2 = Subtraction(number, number_3, lacing=Longest)
number_4 = DoubleInput(2.5)
subtract_3 = Subtraction(number, number_4, lacing=Longest)
