# Dynamo graph TestTakeEveryNth.dyn (Dynamo 1.0.1.1743)

number = DoubleInput(1..10)
number_2 = DoubleInput(3)
number_3 = DoubleInput(1)
takeEveryNthItem = List.TakeEveryNthItem(number, number_2, number_3)
