# Dynamo graph TestTakeEveryNth_ListOfListAsInput.dyn (Dynamo 0.6.2.29585)

number = DoubleInput(2)
number_2 = DoubleInput(1..2)
list = NewList(index0=number_2, index1=number_2, index2=number_2, index3=number_2, index4=number_2, index5=number_2)
number_3 = DoubleInput(1)
take_every_nth = TakeEveryNth(number, list, number_3)
