# Dynamo graph TestTakeFromList_ListOfListAsInput.dyn (Dynamo 0.6.2.29585)

number = DoubleInput(2)
number_2 = DoubleInput(1..5)
list = NewList(index0=number_2, index1=number_2, index2=number_2, index3=number_2)
take_from_list = TakeList(number, list)
