# Dynamo graph TestTangent.dyn (Dynamo 1.0.1.1743)

number = DoubleInput(18.12)
radiansToDegrees = Math.RadiansToDegrees(number)
tan = Math.Tan(radiansToDegrees, lacing=Longest)
number_2 = DoubleInput(-5)
radiansToDegrees_2 = Math.RadiansToDegrees(number_2)
tan_2 = Math.Tan(radiansToDegrees_2, lacing=Longest)
number_3 = DoubleInput(0)
radiansToDegrees_3 = Math.RadiansToDegrees(number_3)
tan_3 = Math.Tan(radiansToDegrees_3, lacing=Longest)
number_4 = DoubleInput(3)
radiansToDegrees_4 = Math.RadiansToDegrees(number_4)
tan_4 = Math.Tan(radiansToDegrees_4, lacing=Longest)
