# Dynamo graph TestThickenCurve.dyn (Dynamo 1.0.1.1743)

number = DoubleInput(10)
number_2 = DoubleInput(0)
byCoordinates = Point.ByCoordinates(x=number, y=number_2, z=number_2, lacing=Longest)
byCoordinates_2 = Point.ByCoordinates(x=number, y=number, z=number_2, lacing=Longest)
byCoordinates_3 = Point.ByCoordinates(x=number_2, y=number, z=number_2, lacing=Longest)
byThreePoints = Arc.ByThreePoints(firstPoint=byCoordinates, secondPoint=byCoordinates_2, thirdPoint=byCoordinates_3, lacing=Longest)
number_3 = DoubleInput(1)
number_4 = DoubleInput(0)
number_5 = DoubleInput(0)
number_6 = DoubleInput(1)
byCoordinates_4 = Point.ByCoordinates(x=number_4, y=number_5, z=number_6, lacing=Longest)
asVector = Point.AsVector(byCoordinates_4)
byThickeningCurve = PolyCurve.ByThickeningCurve(curve=byThreePoints, thickness=number_3, nor=asVector, lacing=Longest)
