# Dynamo graph TestXor.dyn (Dynamo 1.0.1.1743)

boolean = BoolSelector(false)
boolean_2 = BoolSelector(true)
xor = Logic.Xor(boolean, boolean_2)
xor_2 = Logic.Xor(boolean, boolean)
xor_3 = Logic.Xor(boolean_2, boolean_2)
