# Dynamo graph TestXor_NumberInput.dyn (Dynamo 1.0.1.1743)

number = DoubleInput(0)
number_2 = DoubleInput(5)
xor = Logic.Xor(number, number_2)
xor_2 = Logic.Xor(number, number)
xor_3 = Logic.Xor(number_2, number_2)
