# Dynamo graph TestXyPlane.dyn (Dynamo 1.0.1.1743)

number = DoubleInput(1)
number_2 = DoubleInput(-1)
byCoordinates = Point.ByCoordinates(x=number, y=number, z=number_2, lacing=Longest)
number_3 = DoubleInput(1)
byCoordinates_2 = Point.ByCoordinates(x=number, y=number, z=number_3, lacing=Longest)
byStartPointEndPoint = Line.ByStartPointEndPoint(startPoint=byCoordinates, endPoint=byCoordinates_2, lacing=Longest)
identity = CoordinateSystem.Identity()
XYPlane = CoordinateSystem.XYPlane(identity, lacing=Longest)
intersect = Geometry.Intersect(geometry=byStartPointEndPoint, other=XYPlane, lacing=Longest)
X = Point.X(intersect, lacing=Longest)
Y = Point.Y(intersect, lacing=Longest)
Z = Point.Z(intersect, lacing=Longest)
