# Dynamo graph TestXyzAverage.dyn (Dynamo 1.0.1.1743)

number = DoubleInput(0)
number_2 = DoubleInput(-2.5)
byCoordinates = Point.ByCoordinates(x=number, y=number_2, z=number, lacing=Longest)
byCoordinates_2 = Point.ByCoordinates(x=number_2, y=number_2, z=number, lacing=Longest)
number_3 = DoubleInput(2.5)
byCoordinates_3 = Point.ByCoordinates(x=number_3, y=number, z=number, lacing=Longest)
create_list = List.Create(byCoordinates, byCoordinates_2, byCoordinates_3)
code_block = CodeBlock(pts=create_list) { Math.Average(pts.X); Math.Average(pts.Y); Math.Average(pts.Z); }
byCoordinates_4 = Point.ByCoordinates(x=code_block.out0, y=code_block.out1, z=code_block.out2, lacing=Longest)
X = Point.X(byCoordinates_4, lacing=Longest)
watch = Watch(X)
Y = Point.Y(byCoordinates_4, lacing=Longest)
watch_2 = Watch(Y)
Z = Point.Z(byCoordinates_4, lacing=Longest)
watch_3 = Watch(Z)
