# Dynamo graph TestXzPlane.dyn (Dynamo 1.0.1.1743)

number = DoubleInput(2)
number_2 = DoubleInput(-1)
byCoordinates = Point.ByCoordinates(x=number, y=number_2, z=number, lacing=Longest)
number_3 = DoubleInput(1)
byCoordinates_2 = Point.ByCoordinates(x=number, y=number_3, z=number, lacing=Longest)
byStartPointEndPoint = Line.ByStartPointEndPoint(startPoint=byCoordinates, endPoint=byCoordinates_2, lacing=Longest)
identity = CoordinateSystem.Identity()
ZXPlane = CoordinateSystem.ZXPlane(identity, lacing=Longest)
intersect = Geometry.Intersect(geometry=byStartPointEndPoint, other=ZXPlane, lacing=Longest)
X = Point.X(intersect, lacing=Longest)
Y = Point.Y(intersect, lacing=Longest)
Z = Point.Z(intersect, lacing=Longest)
