# Dynamo graph TestYzPlane.dyn (Dynamo 1.0.1.1743)

number = DoubleInput(-1)
number_2 = DoubleInput(3)
byCoordinates = Point.ByCoordinates(x=number, y=number_2, z=number_2, lacing=Longest)
number_3 = DoubleInput(1)
byCoordinates_2 = Point.ByCoordinates(x=number_3, y=number_2, z=number_2, lacing=Longest)
byStartPointEndPoint = Line.ByStartPointEndPoint(startPoint=byCoordinates, endPoint=byCoordinates_2, lacing=Longest)
identity = CoordinateSystem.Identity()
YZPlane = CoordinateSystem.YZPlane(identity, lacing=Longest)
intersect = Geometry.Intersect(geometry=byStartPointEndPoint, other=YZPlane, lacing=Longest)
X = Point.X(intersect, lacing=Longest)
Y = Point.Y(intersect, lacing=Longest)
Z = Point.Z(intersect, lacing=Longest)
