# Dynamo graph Test_Solid.BoxCenterAndDimensions.dyn (Dynamo 0.7.0.29253)

code_block = CodeBlock { Point.ByCoordinates(0,0,0); }
double_slider = DoubleSlider(11.805, range=0..100)
boxByCenterAndDimensions = DummyNode(code_block, double_slider, double_slider, inputCount=4, outputCount=1, legacyNodeName=Solid.BoxByCenterAndDimensions, legacyAssembly=RevitNodes.dll, nodeNature=Unresolved)  # "Solid.BoxByCenterAndDimensions"
