# Dynamo graph Transpose_3061.dyn (Dynamo 0.6.3.7993)

number = DoubleInput(0)
number_2 = DoubleInput(10)
number_3 = DoubleInput(1)
number_range = NumberRange(number, number_2, number_3, lacing=Longest)
number_4 = DoubleInput(11)
number_5 = DoubleInput(20)
number_6 = DoubleInput(1)
number_range_2 = NumberRange(number_4, number_5, number_6, lacing=Longest)
list = NewList(index0=number_range, index1=number_range_2)
transpose_lists = Transpose(list)
