# Dynamo graph multi-custom-070-2.dyn (Dynamo 0.7.0.0)

number = DoubleInput(2..5)
my_custom_node = Custom[My Custom Node](list=number)
watch = Watch(my_custom_node.reverse)
watch_2 = Watch(my_custom_node.palindrome)
watch_3 = Watch(number)
watch_4 = Watch(my_custom_node.length)
number_2 = DoubleInput(4)
number_3 = DoubleInput(3)
number_4 = DoubleInput(6)
add_three = Custom[Add Three](x=number_2, y=number_3, z=number_4)
watch_5 = Watch(add_three)
