# Dynamo graph multi-custom.dyn (Dynamo 1.0.1.1743)

number = DoubleInput(0)
create_list = List.Create(number)
de_cons_list = Custom[De-Cons List](list=create_list)
watch = Watch(de_cons_list.item)
watch_2 = Watch(de_cons_list.rest)
