# Dynamo graph partial-multi-custom.dyn (Dynamo 1.0.1.1743)

number = DoubleInput(0)
create_list = List.Create(number)
create_list_2 = List.Create(create_list)
de_cons_list = Custom[De-Cons List]()
map = List.Map(list=create_list_2, f_x=de_cons_list.item)
watch = Watch(map)
map_2 = List.Map(list=create_list_2, f_x=de_cons_list.rest)
watch_2 = Watch(map_2)
