# Dynamo graph partial-multi.dyn (Dynamo 1.0.1.1743)

number = DoubleInput(0)
create_list = List.Create(number)
create_list_2 = List.Create(create_list)
deconstruct = List.Deconstruct()
map = List.Map(list=create_list_2, f_x=deconstruct.rest)
watch = Watch(map)
map_2 = List.Map(list=create_list_2, f_x=deconstruct.first)
watch_2 = Watch(map_2)
