# Dynamo custom node partial-multiout-customnode.dyf "Test Lacing" (Dynamo 2.0.1.5055)
# category: BIM4StrucProjects.Testing

population = Input(population: var[]..[])
code_block = CodeBlock(pop=population) { pop[0]; pop[1]; pop[2]; }
add = code_block.out0 + code_block.out1
intermediate1 = Output(add)
div = add / code_block.out2
finalresult = Output(div)
div_2 = code_block.out0 / code_block.out2
intermediate2 = Output(div_2)
