# Dynamo graph partial-multiout-customnode.dyn (Dynamo 2.1.0.5286)

test_lacing = Custom[Test Lacing]()  # unwired: population
code_block = CodeBlock(a=test_lacing.intermediate1, b=test_lacing.finalresult, c=test_lacing.intermediate2) { [a,b,c]; }
code_block_2 = CodeBlock()
# ---------- code_block_2.designscript (3 lines) ----------
[0,
2,
4];
# ----------------------------------------
function_apply = ApplyFunction(func=code_block, arg1=code_block_2)
watch = Watch(function_apply)
