# Dynamo graph multiplicationAndAdd.dyn

number = DoubleInput(2)
number_2 = DoubleInput(1)
multiplication = Multiplication(number, number_2)
number_3 = DoubleInput(3)
add = Addition(multiplication, number_3)
