# Dynamo graph multithread-test.dyn (Dynamo 1.0.1.1743)

number = DoubleInput(1000)
pause = Pause(number)
create_thunk = Thunk(pause)
number_2 = DoubleInput(10)
ofRepeatedItem = List.OfRepeatedItem(item=create_thunk, amount=number_2)
apply_function = ApplyFunction()
map = List.Map(list=ofRepeatedItem, f_x=apply_function)
string = StringInput("done!")
perform_all = Begin(expr1=map, expr2=string)
watch = Watch(perform_all)
create_thunk_2 = Thunk(watch)
future = Future(create_thunk_2, lacing=Longest)
future_2 = Future(ofRepeatedItem, lacing=Longest)
now = Now(future_2, lacing=Longest)
perform_all_2 = Begin(expr1=now, expr2=string)
watch_2 = Watch(perform_all_2)
create_thunk_3 = Thunk(watch_2)
future_3 = Future(create_thunk_3, lacing=Longest)
