# Dynamo graph imperative_indexing.dyn (Dynamo 2.15.0.4651)

byCoordinates = Point.ByCoordinates()
code_block = CodeBlock { 10; }
byCoordinates_2 = Point.ByCoordinates(x=code_block)
code_block_2 = CodeBlock(a=byCoordinates, b=byCoordinates_2) { [a,b]; }
code_block_3 = CodeBlock(p=code_block_2)
# ---------- code_block_3.designscript (5 lines) ----------
p;
[Imperative]
{
return p[0].DistanceTo(p[1]);
};
# ----------------------------------------
