# Dynamo graph multipleoutput.dyn (Dynamo 0.8.2.2250)

code_block = CodeBlock { {1,2}; }
code_block_2 = CodeBlock { {true, false}; }
filterByBoolMask = List.FilterByBoolMask(list=code_block, mask=code_block_2)
