# Dynamo graph Builtin.dyn (Dynamo 0.9.0.2712)

code_block = CodeBlock { {4,5}; }
countFalse = CountFalse(code_block)
countTrue = CountTrue(code_block)
code_block_2 = CodeBlock { 1..10; }
count = Count(code_block_2)
countFalse_2 = CountFalse(code_block_2)
code_block_3 = CodeBlock { {1,2,3,{4,5}}; }
flatten = Flatten(code_block_3)
code_block_4 = CodeBlock { 1..10; }
countTrue_2 = CountTrue(code_block_4)
getKeys = GetKeys(code_block_3)
equals = Equals(code_block_4, code_block_2)
code_block_5 = CodeBlock { {2,3}; }
code_block_6 = CodeBlock { 1; }
insert = Insert(code_block_2, code_block_5, code_block_6)
sortIndexByValue = SortIndexByValue()
code_block_7 = CodeBlock { {1,2,3,4,5,6,5,6}; }
code_block_8 = CodeBlock { true; }
sortIndexByValue_2 = SortIndexByValue(code_block_7, code_block_8)
sortIndexByValue_3 = SortIndexByValue(code_block_4)
contains = Contains(code_block_2, code_block_5, lacing=Longest)
contains_2 = Contains(code_block_2, code_block_5)
allFalse = AllFalse(code_block_2)
containsKey = ContainsKey(code_block_4, code_block)
allTrue = AllTrue(code_block_4)
getValues = GetValues(code_block_4)
rank = Rank(code_block_2)
setDifference = SetDifference(code_block_4, code_block_5)
setUnion = SetUnion(code_block_4, code_block_2)
isUniformDepth = IsUniformDepth(code_block_2)
isRectangular = IsRectangular(code_block_2)
isHomogeneous = IsHomogeneous(code_block_2)
rank_2 = Rank(code_block_2)
normalizeDepth = NormalizeDepth(code_block_3)
