# Dynamo graph Excel.dyn (Dynamo 0.8.2.1957)

file_path = Filename("C:\ProgramData\Dynamo\0.8\samples\Data\helix.xlsx")
fromPath = FileObject(file_path)  # "File.FromPath"
string = StringInput("helix")
readFromFile = Excel.ReadFromFile(file=fromPath, sheetName=string)
