# Dynamo graph FFI.dyn (Dynamo 0.8.2.2022)

anotherClassWithNameConflict = FFITarget.FirstNamespace.AnotherClassWithNameConflict.AnotherClassWithNameConflict()
propertyF = FFITarget.SecondNamespace.AnotherClassWithNameConflict.PropertyF()
testLogWarning = FFITarget.TestLogWarning.TestLogWarning()
anotherClassWithNameConflict_2 = FFITarget.SecondNamespace.AnotherClassWithNameConflict.AnotherClassWithNameConflict()
abstractDerivedDisposeTracer2 = FFITarget.AbstractDerivedDisposeTracer2.AbstractDerivedDisposeTracer2()
barClassAttribute = FFITarget.BarClassAttribute.BarClassAttribute()
dummyClassA = FFITarget.DummyClassA.DummyClassA()
derivedDummy = FFITarget.DerivedDummy.DerivedDummy()
code_block = CodeBlock { 1; }
globalClass = GlobalClass.GlobalClass(code_block)
globalClass_2 = GlobalClass.GlobalClass()
classWithRefParams = FFITarget.ClassWithRefParams.ClassWithRefParams()
