# Dynamo graph Imperative.dyn (Dynamo 0.8.2.1915)

code_block = CodeBlock()
# ---------- code_block.designscript (2 lines) ----------
//a
a=1;
# ----------------------------------------
code_block_2 = CodeBlock(b=code_block) { b; }
code_block_3 = CodeBlock()
# ---------- code_block_3.designscript (8 lines) ----------
z1 = [Imperative]
{
x={1,2,3,4};
for(i in x)
{
}
return = 1;
};
# ----------------------------------------
