# Dynamo graph document.dyn (Dynamo 0.8.2.2073)

current = Document.Current()
isFamilyDocument = Document.IsFamilyDocument(current)
isFamilyDocument_2 = Document.IsFamilyDocument(current)
location = Document.Location(current)
activeView = Document.ActiveView(current)
