# Dynamo graph geometryworkflow.dyn (Dynamo 0.8.2.1957)

code_block = CodeBlock { 1; }
byCoordinates = Point.ByCoordinates(z=code_block)
byCenterPointRadius = Circle.ByCenterPointRadius(centerPoint=byCoordinates)
toNurbsCurve = Curve.ToNurbsCurve(byCenterPointRadius)
code_block_2 = CodeBlock { 10; }
byCoordinates_2 = Point.ByCoordinates(z=code_block_2)
byCenterPointRadius_2 = Circle.ByCenterPointRadius(centerPoint=byCoordinates_2)
toNurbsCurve_2 = Curve.ToNurbsCurve(byCenterPointRadius_2)
code_block_3 = CodeBlock(a=toNurbsCurve, b=toNurbsCurve_2) { {a,b}; }
byLoft = Solid.ByLoft(code_block_3)
code_block_4 = CodeBlock(a=toNurbsCurve, b=toNurbsCurve_2) { {a,b}; }
byLoft_2 = Surface.ByLoft(code_block_4)
