# Dynamo graph mutationTest1.dyn (Dynamo 0.8.2.1870)

code_block = CodeBlock { 100; }
code_block_2 = CodeBlock(y=code_block) { y; }
code_block_3 = CodeBlock { 1..5; }
byCoordinates = Point.ByCoordinates(x=code_block, y=code_block_3)
