# Dynamo graph numberSequence.dyn (Dynamo 0.8.2.1873)

code_block = CodeBlock { 1; }
code_block_2 = CodeBlock { 10; }
code_block_3 = CodeBlock { 1; }
number_sequence = NumberSeq(code_block, code_block_2, code_block_3, lacing=Longest)
