# Dynamo graph partition5.dyn (Dynamo 0.8.1.1062)

n1 = CodeBlock { 1; }  # "1"
n2 = CodeBlock { 2; }  # "2"
n3 = CodeBlock { 3; }  # "3"
X = CodeBlock(a=n1, b=n2, c=n3) { a + b + c; }
n4 = CodeBlock(m=X) { m; }  # "4"
n5 = CodeBlock(n=X) { n; }  # "5"
