# Dynamo graph splitstring.dyn (Dynamo 0.8.2.1957)

code_block = CodeBlock { "foo,bar.qux"; }
code_block_2 = CodeBlock { ","; "."; }
split = String.Split(code_block, code_block_2.out0, code_block_2.out1)
