# Dynamo graph stringNodesInNeedOfEscaping.dyn "DYN-1261 NodeToCode Escape Strings v2" (Dynamo 2.8.0.3135)

string = StringInput("C:\")
string_2 = StringInput("4\"")
string_3 = StringInput("\"Hello, world.\"")
string_4 = StringInput("Hello\r\nWorld")
string_5 = StringInput("\tHello World")
string_6 = StringInput("\u33A1")
string_7 = StringInput("\u00B2")
string_8 = StringInput("\\SERVER\PATH")
list_create = List.Create(item0=string, item1=string_2, item2=string_3, item3=string_4, item4=string_5, item5=string_6, item6=string_7, item7=string_8)
watch = Watch(list_create)
