# Dynamo graph tostaticproperty.dyn (Dynamo 2.0.1.4375)

code_block = CodeBlock { 23; }
valueContainer = FFITarget.ValueContainer.ValueContainer(value=code_block)
someValue = FFITarget.ValueContainer.SomeValue(valueContainer=valueContainer)
