# Dynamo graph DefaultArgs.dyn (Dynamo 0.8.2.1915)

byCoordinates = Point.ByCoordinates()
code_block = CodeBlock { 4; }
byCoordinates_2 = Point.ByCoordinates(y=code_block)
byStartPointEndPoint = Line.ByStartPointEndPoint(startPoint=byCoordinates, endPoint=byCoordinates_2)
