# Dynamo graph Point.ByCoordinates.dyn (Dynamo 0.8.2.1915)

code_block = CodeBlock { 1..10; }
code_block_2 = CodeBlock { {2,5}; }
byCoordinates = Point.ByCoordinates(x=code_block, y=code_block_2, lacing=CrossProduct)
