# Dynamo graph file.dyn (Dynamo 0.8.2.2022)

number = DoubleInput(1)
# note: 3. Select "+" nodes and convert N2C
add = number + number
number_2 = DoubleInput(2)
add_2 = number_2 + number_2
# note: 1. Select multiply node->N2C
# 2. Undo
mul = add * add_2
