# Dynamo graph form.dyn (Dynamo 0.8.2.2073)

byCoordinates = Point.ByCoordinates()
number = DoubleInput(5)
byCoordinates_2 = Point.ByCoordinates(y=number)
number_2 = DoubleInput(10)
byCoordinates_3 = Point.ByCoordinates(x=number_2, y=number_2)
number_3 = DoubleInput(15)
byCoordinates_4 = Point.ByCoordinates(x=number_3)
create = List.Create(byCoordinates, byCoordinates_2, byCoordinates_3, byCoordinates_4)
byPoints = NurbsCurve.ByPoints(create)
# note: Multiple creation methods exist for most curves.
byStartPointEndPoint = Line.ByStartPointEndPoint(startPoint=byCoordinates, endPoint=byCoordinates_2)
length = Curve.Length(byStartPointEndPoint)
boolean = BoolSelector(true)
byControlPoints = NurbsCurve.ByControlPoints(create, arg2=boolean)
byPoints_2 = PolyCurve.ByPoints(points=create)
code_block = CodeBlock { 0..1..#20; }
# note: Curves, Polycurves (collections of Curves), Nurbs, and Lines all derive from "Curves", and so all Curve "Actions" and "Queries" can be done to all of them
pointAtParameter = Curve.PointAtParameter(curve=byPoints_2, param=code_block)
# note: Pass any curve element to Revit Elements that are driven by Lines or other Curves to create them
byCurve = ModelCurve.ByCurve()
code_block_2 = CodeBlock { 5; }
byCoordinates_5 = Point.ByCoordinates(z=code_block_2)
number_4 = DoubleInput(5)
byCoordinates_6 = Point.ByCoordinates(y=number_4, z=code_block_2)
number_5 = DoubleInput(10)
byCoordinates_7 = Point.ByCoordinates(x=number_5, y=number_5, z=code_block_2)
number_6 = DoubleInput(15)
byCoordinates_8 = Point.ByCoordinates(x=number_6, z=code_block_2)
create_2 = List.Create(byCoordinates_5, byCoordinates_6, byCoordinates_7, byCoordinates_8)
code_block_3 = CodeBlock { 3; }
code_block_4 = CodeBlock { true; }
byControlPoints_2 = NurbsCurve.ByControlPoints(create_2, code_block_3, code_block_4)
byPoints_3 = PolyCurve.ByPoints(points=create_2)
code_block_5 = CodeBlock(a=byPoints_3, b=byPoints_2) { {a,b}; }
byLoftCrossSections = Form.ByLoftCrossSections(code_block_5)
