# Dynamo graph multipleoutput.dyn (Dynamo 0.8.2.2073)

code_block = CodeBlock { 1..20; }
code_block_2 = CodeBlock { 5; }
gt = code_block > code_block_2
filterByBoolMask = List.FilterByBoolMask(list=code_block, mask=gt)
