# Dynamo graph undo1.dyn (Dynamo 0.8.1.1401)

byCoordinates = Point.ByCoordinates()
number = DoubleInput(5)
byCoordinates_2 = Point.ByCoordinates(y=number)
number_2 = DoubleInput(10)
byCoordinates_3 = Point.ByCoordinates(x=number_2, y=number_2)
number_3 = DoubleInput(15)
byCoordinates_4 = Point.ByCoordinates(x=number_3)
create = List.Create(byCoordinates, byCoordinates_2, byCoordinates_3, byCoordinates_4)
byPoints = PolyCurve.ByPoints(points=create)
code_block = CodeBlock { 0..1..#20; }
pointAtParameter = Curve.PointAtParameter(curve=byPoints, param=code_block)
boolean = BoolSelector(true)
byControlPoints = NurbsCurve.ByControlPoints(create, arg2=boolean)
byPoints_2 = NurbsCurve.ByPoints(create)
byStartPointEndPoint = Line.ByStartPointEndPoint(startPoint=byCoordinates, endPoint=byCoordinates_2)
length = Curve.Length(byStartPointEndPoint)
