# Dynamo graph undo2.dyn (Dynamo 0.8.1.1401)

number = DoubleInput(1..50..5)
byCoordinates = Point.ByCoordinates(x=number, y=number, lacing=CrossProduct)
flatten = Flatten(byCoordinates)
code_block = CodeBlock { 0; }
number_slider = DoubleSlider(28.6701556, range=-10..60 step 0.1)
number_slider_2 = DoubleSlider(11.50111001, range=-10..60 step 0.1)
byCoordinates_2 = Point.ByCoordinates(x=number_slider, y=number_slider_2)
distanceTo = Geometry.DistanceTo(geometry=flatten, other=byCoordinates_2, lacing=Longest)
code_block_2 = CodeBlock(x=distanceTo) { x/2; }
byCoordinates_3 = Vector.ByCoordinates(x=code_block, y=code_block, z=code_block_2)
add = Point.Add(point=flatten, vectorToAdd=byCoordinates_3)
code_block_3 = CodeBlock(x=distanceTo) { x/15; }
byPointsRadius = Cylinder.ByPointsRadius(flatten, add, code_block_3)
