# Dynamo graph workflow2.DYN (Dynamo 0.8.1.1172)

code_block = CodeBlock { 1; }
byCoordinates = Point.ByCoordinates(x=code_block)
code_block_2 = CodeBlock { 2; }
byCoordinates_2 = Point.ByCoordinates(x=code_block_2)
create = List.Create(byCoordinates, byCoordinates_2)
byStartPointEndPoint = Line.ByStartPointEndPoint(startPoint=byCoordinates, endPoint=byCoordinates_2)
