# Dynamo graph workflow3.DYN (Dynamo 0.8.1.1172)

# note: After hitting "Run" or with Run Automatically enabled, see the geometric entity either in the Background Peview, in Watch 3d, or as data in a Watch node.  Elements will highlight in Background when the node is selected

byCoordinates = Point.ByCoordinates()
byCoordinates_2 = Point.ByCoordinates()
watch = Watch(byCoordinates_2)
asVector = Point.AsVector(watch)
add = Point.Add(point=byCoordinates, vectorToAdd=asVector)
