# Dynamo graph workflow4.DYN (Dynamo 0.8.1.1172)

# note: After hitting "Run" or with Run Automatically enabled, see the geometric entity either in the Background Peview, in Watch 3d, or as data in a Watch node.  Elements will highlight in Background when the node is selected

code_block = CodeBlock { t1 = Point.ByCoordinates(0, 0, 0); t2 = Point.ByCoordinates(0, 0, 0); }
watch = Watch(code_block.t2)
asVector = Point.AsVector(watch)
add = Point.Add(point=code_block.t1, vectorToAdd=asVector)
