# Dynamo graph TestNumber_RangeExpr01.dyn (Dynamo 0.7.0.27049)

number = DoubleInput(1..#4..6)
watch = Watch(number)
number_2 = DoubleInput(1..#0..3)
watch_2 = Watch(number_2)
number_3 = DoubleInput(1..#5.3..-3)
watch_3 = Watch(number_3)
