# Dynamo graph TestNumber_RangeExpr02.dyn (Dynamo 0.7.0.30484)

number = DoubleInput(5..1)
watch = Watch(number)
code_block = CodeBlock { 5..1; }
code_block_2 = CodeBlock { 5..1..1; }
code_block_3 = CodeBlock { 5..1..-1; }
code_block_4 = CodeBlock { 1..5; }
code_block_5 = CodeBlock { 1..5..1; }
code_block_6 = CodeBlock { 1..5..-1; }
number_2 = DoubleInput(5..1..1)
watch_2 = Watch(number_2)
number_3 = DoubleInput(5..1..-1)
watch_3 = Watch(number_3)
number_4 = DoubleInput(1..5)
watch_4 = Watch(number_4)
number_5 = DoubleInput(1..5..1)
watch_5 = Watch(number_5)
number_6 = DoubleInput(1..5..-1)
watch_6 = Watch(number_6)
