# Dynamo custom node NestedNodeCustomNode.dyf "NestedNode" (Dynamo 2.6.0.7706)
# category: Test
# Test nested node

num = Input(num: var[]..[])
code_block = CodeBlock(x=num) { x+10; }
out = Output(code_block)
