# Dynamo graph ResolveDummyNodesOnDownloadingPackage.dyn "HowickPackage" (Dynamo 2.5.0.6335)
# packages: HowickMaker 0.4.1

code_block = CodeBlock { Point.ByCoordinates(0,0); }
code_block_2 = CodeBlock { Point.ByCoordinates(2,2); }
byStartPointEndPoint = Line.ByStartPointEndPoint(startPoint=code_block, endPoint=code_block_2)
byCoordinates = Vector.ByCoordinates()
byLineVector = HowickMaker.hMember.ByLineVector(webAxis=byStartPointEndPoint, webNormal=byCoordinates)
code_block_3 = CodeBlock { 2; }
code_block_4 = CodeBlock { "3"; }
addOperationByLocationType = HowickMaker.hMember.AddOperationByLocationType(hMember=byLineVector, locations=code_block_3, types=code_block_4)
watch = Watch(addOperationByLocationType)
