# Dynamo graph createSomePoints.dyn "SingleNode" (Dynamo 2.3.0.5017)

code_block = CodeBlock { 0..15; }
byCartesianCoordinates = Point.ByCartesianCoordinates(x=code_block, y=code_block, z=code_block, lacing=CrossProduct)
X = Point.X(point=byCartesianCoordinates)
count = List.Count(list=X)
