# Dynamo graph 2to3Test.dyn (Dynamo 2.7.0.8615)

python_script = Python()  # IronPython2; unwired: IN[0]
# ---------- python_script.python (9 lines) ----------
import urllib

print "Hello world"

try:  
    x = urllib.request.urlopen("http://dynamobim.org").read()
    print x  
except NameError, err:  
    print err, 'Error Caused'
# ----------------------------------------
