# Dynamo custom node CNWithCPython_Parent.dyf (Dynamo 3.6.1.9895)
# category: python tests

number = Input(number: double[]..[])
python_script = Python(IN[0]=number)  # CPython3
# ---------- python_script.python (1 lines) ----------
OUT = IN[0] *2
# ----------------------------------------
CNWithCPython_Child = Custom[CNWithCPython_Child](number=python_script)
result = Output(CNWithCPython_Child)
