# Dynamo graph CPythonSysPath.dyn (Dynamo 2.8.0.2195)

python_script = Python()  # PythonNet3; unwired: IN[0]
# ---------- python_script.python (13 lines) ----------
# Load the Python Standard and DesignScript Libraries
import sys
import clr

sys.path.append(r'C:\Program Files\dotnet')

# The inputs to this node will be stored as a list in the IN variables.
dataEnteringNode = IN

# Place your code below this line

# Assign your output to the OUT variable.
OUT = sys.path
# ----------------------------------------
python_script_2 = Python()  # IronPython2; unwired: IN[0]
# ---------- python_script_2.python (10 lines) ----------
# Load the Python Standard and DesignScript Libraries
import sys

# The inputs to this node will be stored as a list in the IN variables.
dataEnteringNode = IN

# Place your code below this line

# Assign your output to the OUT variable.
OUT = sys.path
# ----------------------------------------
