# Dynamo graph DynamoPrint.dyn (Dynamo 2.13.0.2944)

string = StringInput("""import sys
print('Hello from Python' + str(sys.version_info.major) + '!!!')""")
greeting_cpython_node = Python()  # CPython3; unwired: IN[0]
# ---------- greeting_cpython_node.python (14 lines) ----------
# Load the Python Standard and DesignScript Libraries
import sys
import clr
clr.AddReference('ProtoGeometry')
from Autodesk.DesignScript.Geometry import *

# The inputs to this node will be stored as a list in the IN variables.
dataEnteringNode = IN

# Place your code below this line
print('Hello from Python' + str(sys.version_info.major) + '!!!')

# Assign your output to the OUT variable.
OUT = 0
# ----------------------------------------
greeting_cpython_string_node = PythonStringNode(script=string, IN[0]=greeting_cpython_node)  # CPython3
greeting_cpython_string_node_2 = PythonStringNode(script=string, IN[0]=greeting_cpython_string_node)  # CPython3
multiple_print_parameter_node = Python(IN[0]=greeting_cpython_string_node_2)  # CPython3
# ---------- multiple_print_parameter_node.python (14 lines) ----------
# Load the Python Standard and DesignScript Libraries
import sys
import clr
clr.AddReference('ProtoGeometry')
from Autodesk.DesignScript.Geometry import *

# The inputs to this node will be stored as a list in the IN variables.
dataEnteringNode = IN

# Place your code below this line
print("Hello", "Dynamo", "Print", "!!!")

# Assign your output to the OUT variable.
OUT = 0
# ----------------------------------------
print_separator_parameter_node = Python(IN[0]=multiple_print_parameter_node)  # CPython3
# ---------- print_separator_parameter_node.python (14 lines) ----------
# Load the Python Standard and DesignScript Libraries
import sys
import clr
clr.AddReference('ProtoGeometry')
from Autodesk.DesignScript.Geometry import *

# The inputs to this node will be stored as a list in the IN variables.
dataEnteringNode = IN

# Place your code below this line
print("Hello", "Dynamo", "Print", "!!!", sep='_')

# Assign your output to the OUT variable.
OUT = 0
# ----------------------------------------
special_character_node = Python(IN[0]=print_separator_parameter_node)  # CPython3
# ---------- special_character_node.python (14 lines) ----------
# Load the Python Standard and DesignScript Libraries
import sys
import clr
clr.AddReference('ProtoGeometry')
from Autodesk.DesignScript.Geometry import *

# The inputs to this node will be stored as a list in the IN variables.
dataEnteringNode = IN

# Place your code below this line
print("Lot's of special characters!!!")

# Assign your output to the OUT variable.
OUT = 0
# ----------------------------------------
