# Dynamo graph HiddenProperties_Python.dyn (Dynamo 2.11.0.3995)

byPlaneOriginNormal = TSpline.TSplineSurface.ByPlaneOriginNormal()
decomposedEdges = TSpline.TSplineTopology.DecomposedEdges(tSplineTopology=byPlaneOriginNormal)
python_script = Python(IN[0]=decomposedEdges.all)  # PythonNet3
# ---------- python_script.python (21 lines) ----------
# Load the Python Standard and DesignScript Libraries
import sys
import clr
clr.AddReference('ProtoGeometry')
from Autodesk.DesignScript.Geometry import *

# The inputs to this node will be stored as a list in the IN variables.
dataEnteringNode = IN

edges_to_inspect = IN[0];
			
sv = edges_to_inspect[0].StartVertex;
ev = edges_to_inspect[0].EndVertex;
			
si = sv.Index;
ei = ev.Index;

# Place your code below this line

# Assign your output to the OUT variable.
OUT = [sv.__class__.__name__, ev.__class__.__name__]
# ----------------------------------------
