# Dynamo graph IronPythonInfo_TestGraph.dyn (Dynamo 2.7.0.8613)

# group: IronPython Runtime Info
python_script = Python()  # IronPython2; unwired: IN[0]
# ---------- python_script.python (23 lines) ----------
# Enable Python support and load DesignScript library
import clr
clr.AddReference('ProtoGeometry')
from Autodesk.DesignScript.Geometry import *

#sys.path.append(r'C:\Program Files (x86)\IronPython 2.7\DLLs')
#sys.path.append(r'C:\Program Files (x86)\IronPython 2.7\Lib')

# Hard-coded path to Core
#import sys
#sys.path.append(r'C:\Users\alfarok\Documents\Dynamo_alfarok\bin\AnyCPU\Debug\Lib')

import sqlite3
import xml

# The inputs to this node will be stored as a list in the IN variables.
dataEnteringNode = IN

# Place your code below this line
output = [sys.version, sys.builtin_module_names, sys.path]

# Assign your output to the OUT variable.
OUT = output
# ----------------------------------------
code_block = CodeBlock(o=python_script) { o[0]; o[1]; o[2]; }
version = Watch(code_block.out0)  # "sys.version"
builtin_module_names = Watch(code_block.out1)  # "sys.builtin_module_names"
path = Watch(code_block.out2)  # "sys.path"

# group: Verify Loaded IronPython Version
code_block_2 = CodeBlock { 0; 5; "2.7.9"; }
substring = String.Substring(str=version, startIndex=code_block_2.out0, length=code_block_2.out1)
eq = substring == code_block_2.out2

# group: Verify Python Standard Library Modules are loaded
count = List.Count(list=builtin_module_names)
code_block_3 = CodeBlock { 59; }
eq_2 = count == code_block_3

# group: Verify builtin modules contains a ref to standard lib bundled w/ core
python_script_2 = Python(IN[0]=path)  # IronPython2
# ---------- python_script_2.python (21 lines) ----------
# Load the Python Standard and DesignScript Libraries
import sys
import clr
clr.AddReference('ProtoGeometry')
from Autodesk.DesignScript.Geometry import *

# The inputs to this node will be stored as a list in the IN variables.
dataEnteringNode = IN

inputPaths = IN[0]
output = []

for path in inputPaths:
	if '\\' in path:
		dir = path.rsplit("\\", 1)[1]
		output.append(dir)

# Place your code below this line

# Assign your output to the OUT variable.
OUT = output
# ----------------------------------------
code_block_4 = CodeBlock { "IronPython.StdLib.2.7.9"; }
contains = List.Contains(list=python_script_2, item=code_block_4)

# group: Include reference to old Python STD Lib location to verify it causes no issues
legacy_python_script = Python()  # IronPython2; unwired: IN[0]
# ---------- legacy_python_script.python (29 lines) ----------
# Enable Python support and load DesignScript library
import clr
clr.AddReference('ProtoGeometry')
from Autodesk.DesignScript.Geometry import *

# Import Python Standard Library
# This import/append is no longer required as of 11/2018
import sys
sys.path.append(r'C:\Program Files (x86)\IronPython 2.7\Lib')

# Load a module from standard lib
import csv

# The inputs to this node will be stored as a list in the IN variables.
dataEnteringNode = IN

# Place your code below this line
output = []

csvPath = r"../../../test/Engine/ProtoTest/ImportFiles/CSV/Set1/test2.csv";
f = open(csvPath, 'r')

reader = csv.reader(f)
for row in reader:
    output.append(row)
f.close()

# Assign your output to the OUT variable.
OUT = output
# ----------------------------------------

# group: Load a module from STD lib without a hardcoded reference (works as of 11/2018)
python_script_3 = Python()  # IronPython2; unwired: IN[0]
# ---------- python_script_3.python (25 lines) ----------
# Enable Python support and load DesignScript library
import clr
clr.AddReference('ProtoGeometry')
from Autodesk.DesignScript.Geometry import *

# Load a module from Python Standard Lib
# Included OOTB as of 11/2018
import csv

# The inputs to this node will be stored as a list in the IN variables.
dataEnteringNode = IN

# Place your code below this line
output = []

csvPath = r"../../../test/Engine/ProtoTest/ImportFiles/CSV/Set1/test2.csv";
f = open(csvPath, 'r')

reader = csv.reader(f)
for row in reader:
    output.append(row)
f.close()

# Assign your output to the OUT variable.
OUT = output
# ----------------------------------------

# group: Compare legacy with present values
code_block_5 = CodeBlock(a=legacy_python_script, b=python_script_3) { List.Flatten(a); List.Flatten(b); }
eq_3 = code_block_5.out0 == code_block_5.out1
allTrue = List.AllTrue(list=eq_3)
