# Dynamo graph PythonCustomNodeHomeWorkspace.dyn (Dynamo 2.8.0.1775)

number_slider = DoubleSlider(89.3, range=0..100 step 0.1)
pythonCustomNodeTest = Custom[PythonCustomNodeTest](IN=number_slider)  # test python in a custom node
watch = Watch(pythonCustomNodeTest)
CNWithoutPythonNode = Custom[CNWithoutPythonNode](IN=number_slider)
watch_2 = Watch(CNWithoutPythonNode)
