# Dynamo custom node PythonCustomNodeTest.dyf (Dynamo 2.3.0.6256)
# category: Testing
# test python in a custom node

IN = Input(IN: var[]..[])
python_script = Python(IN[0]=IN)
# ---------- python_script.python (1 lines) ----------
OUT = IN[0]
# ----------------------------------------
OUT = Output(python_script)
