# Dynamo graph PythonGeometry.dyn (Dynamo 2.7.0.8546)

code_block = CodeBlock { 0; }
byCoordinates = Point.ByCoordinates(x=code_block, y=code_block, z=code_block)
python_script = Python(IN[0]=byCoordinates)  # CPython3; unwired: IN[1]
# ---------- python_script.python (21 lines) ----------
# Load the Python Standard and DesignScript Libraries

import sys
import clr
clr.AddReference('ProtoGeometry')
from Autodesk.DesignScript.Geometry import *


# The inputs to this node will be stored as a list in the IN variables.
pointA = IN[0]

# Mix float and int args to make this interesting
pointB = Point.ByCoordinates(5.0, 0, 0);

line = Line.ByStartPointEndPoint(pointA, pointB);

circle = Circle.ByCenterPointRadius(pointA, 5)
# Place your code below this line

# Assign your output to the OUT variable.
OUT = [circle, line]
# ----------------------------------------
code_block_2 = CodeBlock(out=python_script) { out[0]; out[1]; }
centerPoint = Circle.CenterPoint(circle=code_block_2.out0)
radius = Circle.Radius(circle=code_block_2.out0)
