# Dynamo graph WithCPython_DuplicateGuid_1.dyn (Dynamo 3.6.1.9895)

code_block = CodeBlock { 5; }
python_script = Python(IN[0]=code_block)  # CPython3
# ---------- python_script.python (1 lines) ----------
OUT = IN[0] * 2
# ----------------------------------------
watch = Watch(python_script)
