# Dynamo graph WithCPython_DuplicateGuid_2.dyn (Dynamo 3.6.1.9895)

code_block = CodeBlock { 50; }
python_script = Python(IN[0]=code_block)  # CPython3
# ---------- python_script.python (1 lines) ----------
OUT = IN[0] * 5
# ----------------------------------------
watch = Watch(python_script)
