# Dynamo graph WithNestedCPythonCustomNodes.dyn (Dynamo 3.6.1.9895)

code_block = CodeBlock { 5; }
# note: Custom node with another custom node placed inside. Each doubles the input value.
CNWithCPython_Parent = Custom[CNWithCPython_Parent](number=code_block)
watch = Watch(CNWithCPython_Parent)
