# Dynamo graph WorkspaceWithMultiplePythonEngines.dyn (Dynamo 2.7.0.8613)

python_script = Python()  # IronPython2; unwired: IN[0]
# ---------- python_script.python (13 lines) ----------
# Load the Python Standard and DesignScript Libraries
import sys
import clr
clr.AddReference('ProtoGeometry')
from Autodesk.DesignScript.Geometry import *

# The inputs to this node will be stored as a list in the IN variables.
dataEnteringNode = IN

# Place your code below this line

# Assign your output to the OUT variable.
OUT = sys.version.partition(' ')[0]
# ----------------------------------------
python_script_2 = Python(IN[0]=python_script)  # IronPython2
# ---------- python_script_2.python (11 lines) ----------
# Load the Python Standard and DesignScript Libraries
import sys
import clr
clr.AddReference('ProtoGeometry')
from Autodesk.DesignScript.Geometry import *

# The inputs to this node will be stored as a list in the IN variables.
# Place your code below this line

# Assign your output to the OUT variable.
OUT = [IN[0], sys.version.partition(' ')[0]]
# ----------------------------------------
