# Dynamo graph cpython_reloaded_class_instances.dyn (Dynamo 2.12.0.5174)

python_script = Python()  # PythonNet3; unwired: IN[0]
# ---------- python_script.python (8 lines) ----------
# Load the Python Standard and DesignScript Libraries
import sys
import clr
sys.path.append(r'..\..\..\test\core\python\module_reload')
import reloaded_class


OUT = reloaded_class.reloaded_class()
# ----------------------------------------
python_script_2 = Python(IN[0]=python_script)  # PythonNet3
# ---------- python_script_2.python (8 lines) ----------
# Load the Python Standard and DesignScript Libraries
import sys
import clr
sys.path.append(r'..\..\..\test\core\python\module_reload')
import reloaded_class


OUT = [IN[0].get_data(),reloaded_class.reloaded_class().get_data()]
# ----------------------------------------
