# Dynamo graph cpythoncustomclass.dyn (Dynamo 2.8.0.1915)

classdef = Python()  # PythonNet3; unwired: IN[0]
# ---------- classdef.python (16 lines) ----------
# Load the Python Standard and DesignScript Libraries
import sys
import clr
clr.AddReference('ProtoGeometry')
from Autodesk.DesignScript.Geometry import *

# The inputs to this node will be stored as a list in the IN variables.
class myClass:
	def __init__(self,name):
		self.name = name
	
	def newName(self,x):
		return self.name+x	
	

OUT = myClass("firstName")
# ----------------------------------------
downstream1 = Python(IN[0]=classdef)  # PythonNet3
# ---------- downstream1.python (13 lines) ----------
# Load the Python Standard and DesignScript Libraries
import sys
import clr
clr.AddReference('ProtoGeometry')
from Autodesk.DesignScript.Geometry import *

# The inputs to this node will be stored as a list in the IN variables.
test = IN[0]

# Place your code below this line

# Assign your output to the OUT variable.
OUT = test.name
# ----------------------------------------
downstream2 = Python(IN[0]=classdef)  # PythonNet3
# ---------- downstream2.python (13 lines) ----------
# Load the Python Standard and DesignScript Libraries
import sys
import clr
clr.AddReference('ProtoGeometry')
from Autodesk.DesignScript.Geometry import *

# The inputs to this node will be stored as a list in the IN variables.
instance = IN[0]

# Place your code below this line

# Assign your output to the OUT variable.
OUT = instance.newName("lastname")
# ----------------------------------------
