# Dynamo graph cpythoncustomclass_returnManyInstances.dyn (Dynamo 2.8.0.1965)

classdef = Python()  # PythonNet3; unwired: IN[0]
# ---------- classdef.python (16 lines) ----------
# Load the Python Standard and DesignScript Libraries
import sys
import clr
clr.AddReference('ProtoGeometry')
from Autodesk.DesignScript.Geometry import *

# The inputs to this node will be stored as a list in the IN variables.
class myClass:
	def __init__(self,name):
		self.name = name
	
	def newName(self,x):
		return self.name+x	
	
obj = myClass("firstName")
OUT = [obj,obj,obj]
# ----------------------------------------
