# Dynamo graph netDict_from_python.dyn (Dynamo 2.7.0.8544)

code_block = CodeBlock { {"abc":123, "def":10}; }
python_script = Python(IN[0]=code_block)  # IronPython2
# ---------- python_script.python (17 lines) ----------
# Load the Python Standard and DesignScript Libraries
import sys
from System.Collections.Generic import Dictionary,List
import clr

# The inputs to this node will be stored as a list in the IN variables.
dict = IN[0]


# Place your code below this line

net_dict = Dictionary[str,int]()
# Assign your output to the OUT variable.
for k, v in dict.items():
	net_dict.Add(k, v)
	
OUT = net_dict
# ----------------------------------------
