# Dynamo graph pythonEngineTest.dyn (Dynamo 2.7.0.8584)

python_script = Python()  # IronPython2; unwired: IN[0]
# ---------- python_script.python (17 lines) ----------
# Load the Python Standard and DesignScript Libraries
import sys
import clr
clr.AddReference('ProtoGeometry')
from Autodesk.DesignScript.Geometry import *

# The inputs to this node will be stored as a list in the IN variables.
# dataEnteringNode = IN

# Place your code below this line

# Assign your output to the OUT variable.
OUT = sys.version[0:5]

# OUT = aList.count(123)

#OUT = IN[0].count(4)
# ----------------------------------------
