# Dynamo graph pythonFromString2to3Test.dyn (Dynamo 2.9.0.2666)

string = StringInput("""isum = 2019 + 1
strHello = "Hello World "
OUT = strHello + str(isum)""")
python_script_from_string = PythonStringNode(script=string)  # IronPython2
watch = Watch(python_script_from_string)
