# Dynamo graph python_check_output.dyn (Dynamo 2.8.0.2266)

python_script = Python()  # CPython3; unwired: IN[0]
# ---------- python_script.python (5 lines) ----------
dict1 = {
  "company": "Autodesk",
  "founded": "1982",
}
OUT = dict1["company"]+","+dict1["founded"]
# ----------------------------------------
watch = Watch(python_script)
