# Dynamo graph python_dict.dyn (Dynamo 2.1.0.7085)

code_block = CodeBlock { "def"; }
python_script = Python(IN[0]=code_block)
# ---------- python_script.python (12 lines) ----------
# Load the Python Standard and DesignScript Libraries
import sys
import clr

# The inputs to this node will be stored as a list in the IN variables.
key = IN[0]

pyDict = {"abc" : 123, key : 345} 
# Place your code below this line

# Assign your output to the OUT variable.
OUT = pyDict
# ----------------------------------------
