# Dynamo graph python_dict2.dyn (Dynamo 2.7.0.8544)

code_block = CodeBlock { {"dict":{"abcd":123}, "list":1..9}; }
python_script = Python(IN[0]=code_block)  # IronPython2
# ---------- python_script.python (12 lines) ----------
# Load the Python Standard and DesignScript Libraries
import sys
import clr

# The inputs to this node will be stored as a list in the IN variables.
dict = IN[0]


# Place your code below this line

# Assign your output to the OUT variable.
OUT = [dict["dict"], dict["list"]]
# ----------------------------------------
