# Dynamo graph varinpython.dyn (Dynamo 0.6.2.28208)

python_script_with_variable = Python()  # "Python Script With Variable Number of Inputs"
# ---------- python_script_with_variable.python (17 lines) ----------
# Default imports
import sys
import clr
path = r'C:\Autodesk\Dynamo\Core'
exec_path = r'C:\Users\boyerp\Dropbox\Github\Autodesk\DynamoNew\Dynamo\bin\AnyCPU\Debug\dll'
sys.path.append(path)
sys.path.append(exec_path)
clr.AddReference('LibGNet')
from Autodesk.LibG import *

#The input to this node will be stored in the IN0...INX variable(s).
dataEnteringNode = IN0

#Assign your output to the OUT variable
OUT = 0

oker
# ----------------------------------------
