# Dynamo graph withDisposeFFITarget.dyn (Dynamo 3.6.0.6885)

python_script = Python(WidthBorder=176, HeightBorder=117)  # PythonNet3; unwired: IN[0]
# ---------- python_script.python (13 lines) ----------
import clr
clr.AddReference('FFITarget')
from FFITarget import AbstractDerivedDisposeTracer2, AbstractDisposeTracert
clr.AddReference('ProtoGeometry')
from Autodesk.DesignScript.Geometry import *



with AbstractDerivedDisposeTracer2() as test:
    test.StupidPlaceHolderMethod()
    Point.ByCoordinates(10,20)
    
OUT = AbstractDisposeTracert.DisposeCount
# ----------------------------------------
watch = Watch(python_script, WidthBorder=129, HeightBorder=117)
