# Dynamo graph withStatementTest.dyn (Dynamo 3.6.0.6885)

python_script = Python()  # PythonNet3; unwired: IN[0]
# ---------- python_script.python (16 lines) ----------
import clr
clr.AddReference('ProtoGeometry')
from Autodesk.DesignScript.Geometry import *

result = ""

file1 = "test_python_exception.txt"
with open(file1, 'w') as f1:
    f1.write("hello world")
    
    
with open(file1, 'a') as f2:
    result = "test2"
    f2.write("bye world")
    
OUT = result
# ----------------------------------------
watch = Watch(python_script)
