# Dynamo graph RangeMap.dyn (Dynamo 0.9.1.3405)

code_block = CodeBlock { {1,2}; }
code_block_2 = CodeBlock { 5; }
code_block_3 = CodeBlock { 10; }
range = Range(start=code_block_2, end=code_block_3, lacing=Longest)
map = List.Map(list=code_block, f_x=range)
code_block_4 = CodeBlock { {1,2}; }
code_block_5 = CodeBlock { 5; }
code_block_6 = CodeBlock { 1; }
range_2 = Range(end=code_block_5, step=code_block_6, lacing=Longest)
map_2 = List.Map(list=code_block_4, f_x=range_2)
code_block_7 = CodeBlock { {5,10}; }
code_block_8 = CodeBlock { 5; }
code_block_9 = CodeBlock { 1; }
range_3 = Range(start=code_block_8, step=code_block_9, lacing=Longest)
map_3 = List.Map(list=code_block_7, f_x=range_3)
