# Dynamo graph Deffect_1412_CreateList.dyn (Dynamo 1.0.1.1743)

code_block = CodeBlock { 1; }
code_block_2 = CodeBlock { 2; }
create_list = List.Create(code_block, code_block_2)
code_block_3 = CodeBlock { 3; }
