# Dynamo graph MAGN-7073.dyn (Dynamo 0.8.1.902)

code_block = CodeBlock { 0..99; }
xyzFromListOfNumbers = Custom[XyzFromListOfNumbers](list=code_block)  # This node represents an upgrade of the 0.6.3 XyzFromListOfNumbers node to 0.7.x
watch = Watch(xyzFromListOfNumbers)
