# Dynamo graph Scopeif.dyn (Dynamo 0.7.6.4202)

code_block = CodeBlock { false; }
code_block_2 = CodeBlock { true; }
code_block_3 = CodeBlock { false; }
scopeIf = ScopedIf(code_block, code_block_2, code_block_3)
if_ = If()
