# Dynamo custom node recursivesum2.dyf "recursivesum" (Dynamo 0.7.6.4212)
# category: Misc
# testrec

list1 = Input()
count = List.Count(list1)
code_block = CodeBlock { 1; }
gt = count > code_block
watch = Watch(list1)
deconstruct = List.Deconstruct(watch)
watch_2 = Watch(deconstruct.out0)
watch_3 = Watch(deconstruct.out1)
recursivesum = Custom[recursivesum](list1=watch_3)  # testrec
add = watch_2 + recursivesum
code_block_2 = CodeBlock { 0; }
scopeIf = ScopedIf(gt, add, code_block_2)
partsum = Output(scopeIf)
watch_4 = Watch(gt)
