# Dynamo graph wrong.dyn (Dynamo 0.7.0.29218)

code_block = CodeBlock { 1; }
byCoordinates = Point.ByCoordinates(code_block, code_block, code_block)
byCenterPointRadius = Sphere.ByCenterPointRadius(byCoordinates, code_block)
byGeometry = BoundingBox.ByGeometry(byCenterPointRadius)
toPolySurface = BoundingBox.ToPolySurface(byGeometry)
contains = BoundingBox.Contains(toPolySurface, byCoordinates)
