# Dynamo custom node MyReduce.dyf (Dynamo 0.7.1.16961)
# category: Misc

list = Input()
isEmpty = List.IsEmpty(list)
base = Input()
f_x_a = Input()  # "f(x, a)"
firstItem = List.FirstItem(list)
restOfItems = List.RestOfItems(list)
myReduce = Custom[MyReduce](list=restOfItems, f_x_a=f_x_a, base=base)
apply_function = ApplyFunction(f_x_a, firstItem, myReduce)
scopeIf = ScopedIf(isEmpty, base, apply_function)
Output = Output(scopeIf)  # ""
