# Dynamo custom node Sum Numbers.dyf (Dynamo 0.7.1.16961)
# category: Misc

numbers = Input()
isEmpty = List.IsEmpty(numbers)
number = DoubleInput(0)
firstItem = List.FirstItem(numbers)
restOfItems = List.RestOfItems(numbers)
sum_numbers = Custom[Sum Numbers](numbers=restOfItems)
add = firstItem + sum_numbers
scopeIf = ScopedIf(isEmpty, number, add)
Output = Output(scopeIf)  # ""
