# Dynamo graph reduce-example.dyn (Dynamo 0.6.2.29585)

add = Addition()
number = DoubleInput(0)
number_2 = DoubleInput(1)
number_3 = DoubleInput(5)
number_sequence = NumberRange(number_2, number_3, number_2)
reduce = Fold(add, number, number_sequence)
watch = Watch(reduce)
myReduce = Custom[MyReduce](list=number_sequence, f_x_a=add, base=number)
watch_2 = Watch(myReduce)
sum_numbers = Custom[Sum Numbers](numbers=number_sequence)
watch_3 = Watch(sum_numbers)
