# Dynamo graph front_grill_error_standalone.dyn (Dynamo 2.5.3.7984)

list_create = List.Create()  # unwired: item0, item1
number = DoubleInput(100)
byWidthLength = Rectangle.ByWidthLength(width=number, length=number)
byPatch = Surface.ByPatch(closedCurve=byWidthLength)
number_slider = DoubleSlider(0, range=0..1 step 1)
amount_of_stripes = DoubleSlider(31, range=1..31 step 2)
code_block = CodeBlock(numberoflines=amount_of_stripes) { 0..1..#numberoflines; }
getIsoline = Surface.GetIsoline(surface=byPatch, isoDirection=number_slider, parameter=code_block)
horizontal = DoubleSlider(5, range=0..100 step 1)
code_block_2 = CodeBlock(numberoflines=horizontal) { 0..1..#numberoflines; }
pointAtParameter = Curve.PointAtParameter(curve=getIsoline, param=code_block_2, lacing=CrossProduct)
code_block_3 = CodeBlock { 0; }
getItemAtIndex = List.GetItemAtIndex(list=pointAtParameter, index=code_block_3, lacing=CrossProduct)
code_block_4 = CodeBlock { 1; }
getItemAtIndex_2 = List.GetItemAtIndex(list=pointAtParameter, index=code_block_4, lacing=CrossProduct)
code_block_5 = CodeBlock { 1; }
shiftIndices = List.ShiftIndices(list=getItemAtIndex_2, amount=code_block_5)
combine = List.Combine(comb=list_create, list1=getItemAtIndex, list2=shiftIndices)
byPoints = NurbsCurve.ByPoints(points=combine)
code_block_6 = CodeBlock { 0; }
removeItemAtIndex = List.RemoveItemAtIndex(list=byPoints, indices=code_block_6)
list_create_2 = List.Create()  # unwired: item0, item1
getItemAtIndex_3 = List.GetItemAtIndex(list=pointAtParameter, index=code_block_4, lacing=CrossProduct)
getItemAtIndex_4 = List.GetItemAtIndex(list=pointAtParameter, index=code_block_3, lacing=CrossProduct)
shiftIndices_2 = List.ShiftIndices(list=getItemAtIndex_4, amount=code_block_5)
combine_2 = List.Combine(comb=list_create_2, list1=getItemAtIndex_3, list2=shiftIndices_2)
byPoints_2 = NurbsCurve.ByPoints(points=combine_2)
code_block_7 = CodeBlock { 0; }
removeItemAtIndex_2 = List.RemoveItemAtIndex(list=byPoints_2, indices=code_block_7)

# group: Delete causes errors
list_create_3 = List.Create()  # unwired: item0, item1
code_block_8 = CodeBlock { 2; }
dropEveryNthItem = List.DropEveryNthItem(list=getIsoline, n=code_block_8)
amount_of_hight = DoubleSlider(6, range=2..20 step 2)
code_block_9 = CodeBlock(x=amount_of_hight) { 0..1..#x; }
pointAtParameter_2 = Curve.PointAtParameter(curve=dropEveryNthItem, param=code_block_9, lacing=CrossProduct)
code_block_10 = CodeBlock { 1; }
getItemAtIndex_5 = List.GetItemAtIndex(list=pointAtParameter_2, index=code_block_10, lacing=Longest)
code_block_11 = CodeBlock { 0; }
removeItemAtIndex_3 = List.RemoveItemAtIndex(list=getItemAtIndex_5, indices=code_block_11)
code_block_12 = CodeBlock { 1; }
dropEveryNthItem_2 = List.DropEveryNthItem(list=getIsoline, n=code_block_8, offset=code_block_12)
code_block_13 = CodeBlock(x=amount_of_hight) { 0..1..#x; }
pointAtParameter_3 = Curve.PointAtParameter(curve=dropEveryNthItem_2, param=code_block_13, lacing=CrossProduct)
code_block_14 = CodeBlock { 0; }
getItemAtIndex_6 = List.GetItemAtIndex(list=pointAtParameter_3, index=code_block_14, lacing=Longest)
combine_3 = List.Combine(comb=list_create_3, list1=removeItemAtIndex_3, list2=getItemAtIndex_6)
byPoints_3 = NurbsCurve.ByPoints(points=combine_3, lacing=CrossProduct)
list_create_4 = List.Create()  # unwired: item0, item1
code_block_15 = CodeBlock { 0; }
shiftIndices_3 = List.ShiftIndices(list=getItemAtIndex_6, amount=code_block_15)
code_block_16 = CodeBlock { 0; }
shiftIndices_4 = List.ShiftIndices(list=getItemAtIndex_5, amount=code_block_16)
reverse = List.Reverse(list=shiftIndices_4)
code_block_17 = CodeBlock { 0; }
removeItemAtIndex_4 = List.RemoveItemAtIndex(list=reverse, indices=code_block_17)
reverse_2 = List.Reverse(list=removeItemAtIndex_4)
combine_4 = List.Combine(comb=list_create_4, list1=shiftIndices_3, list2=reverse_2)
byPoints_4 = NurbsCurve.ByPoints(points=combine_4, lacing=CrossProduct)
