# Dynamo graph SequenceMap.dyn (Dynamo 0.9.1.3405)

code_block = CodeBlock { {1,2}; }
code_block_2 = CodeBlock { 5; }
code_block_3 = CodeBlock { 3; }
sequence = Sequence(start=code_block_2, amount=code_block_3, lacing=Longest)
map = List.Map(list=code_block, f_x=sequence)
code_block_4 = CodeBlock { {1,2}; }
code_block_5 = CodeBlock { 5; }
code_block_6 = CodeBlock { 2; }
sequence_2 = Sequence(amount=code_block_5, step=code_block_6, lacing=Longest)
map_2 = List.Map(list=code_block_4, f_x=sequence_2)
code_block_7 = CodeBlock { {5,3}; }
code_block_8 = CodeBlock { 5; }
code_block_9 = CodeBlock { 1; }
sequence_3 = Sequence(start=code_block_8, step=code_block_9, lacing=Longest)
map_3 = List.Map(list=code_block_7, f_x=sequence_3)
