# Dynamo graph sequence.dyn (Dynamo 1.0.1.1743)

number = DoubleInput(1)
number_slider = DoubleSlider(50, range=0..100 step 0.1)
range = Range(start=number, end=number_slider, step=number)
formula = Formula("Sin(x)", x=range, lacing=Longest)
watch = Watch(formula)
