# Dynamo graph input_type_from_future.dyn "version test" (Dynamo 2.12.0.5650)

select_roof = DSModelElementSelection()  # 1 picked in the model; graph input

# group: Find upper surface
geometry = Element.Geometry(element=select_roof)
explode = Geometry.Explode(geometry=geometry)
flatten = List.Flatten(list=explode)
code_block = CodeBlock { 0.5; }
normalAtParameter = Surface.NormalAtParameter(surface=flatten, u=code_block, v=code_block)
Z = Vector.Z(vector=normalAtParameter)
code_block_2 = CodeBlock(z=Z) { z>0.01; }
filterByBoolMask = List.FilterByBoolMask(list=flatten, mask=code_block_2)
