# Dynamo graph serialization.dyn (Dynamo 1.2.1.3077)

code_block = CodeBlock { a=42.0; b=cat; }  # unwired: cat
watch = Watch(code_block.a)
string = StringInput("foo")
create = List.Create(string, string, string)
number = DoubleInput(1)
number_2 = DoubleInput(2)
gt = number > number_2
and_ = And(gt, gt, gt, gt, gt, gt)
or_ = Or(gt, gt)

# group: This is a group.
number_3 = DoubleInput(5)
number_slider = DoubleSlider(3, range=0..100 step 0.1)

add = number_3 + number_slider
byCoordinates = Point.ByCoordinates(x=add, y=add, z=add)
byCenterPointRadius = Circle.ByCenterPointRadius(centerPoint=byCoordinates)
