# Dynamo graph sorting.dyn (Dynamo 1.0.1.1743)

string = StringInput("dddd")
string_2 = StringInput("aa")
string_3 = StringInput("c")
string_4 = StringInput("aaaaa")
string_5 = StringInput("bbb")
create_list = List.Create(string, string_2, string_3, string_4, string_5)
sort = List.Sort(create_list)
watch = Watch(sort)
length = String.Length()
sortByFunction = SortByFunction(create_list, length)
watch_2 = Watch(sortByFunction)
