# Dynamo graph TestConcatStringInListMap.dyn (Dynamo 0.7.0.20234)

code_block = CodeBlock { 0..54..10; }
fromObject = String.FromObject(code_block)
code_block_2 = CodeBlock { "a"; }
concat = String.Concat(arg1=code_block_2)
map = List.Map(fromObject, concat)
