# Dynamo graph TestConcatStringNestedListIndependence.dyn (Dynamo 2.14.0.0)

code_block = CodeBlock { ["a","b"]; }
code_block_2 = CodeBlock { ["c","d"]; }
concat = String.Concat(string0=code_block@L1, string1=code_block_2@L1)
