# Dynamo graph TestConcatStringUseLevels.dyn (Dynamo 2.14.0.0)

code_block = CodeBlock { "hello"; }
code_block_2 = CodeBlock { ["a","b"]; }
concat = String.Concat(string0=code_block, string1=code_block_2@L1)
