# Dynamo graph TestConcatString_fromFile.dyn (Dynamo 0.7.4.3075)

file_path = Filename("..\..\..\test\core\string\TestConcatString_fromFile.txt")
fromPath = FileObject(file_path)  # "File.FromPath"
readText = File.ReadText(fromPath)
concat = String.Concat(readText, readText)
watch = Watch(concat)
