# Dynamo graph TestConcatString_fromFunction.dyn (Dynamo 1.0.1.1743)

string = StringInput("yesterday ")
string_2 = StringInput("today.")
concat = String.Concat(string, string_2)
string_3 = StringInput("tomorrow")
concat_2 = String.Concat(concat, string_3)
watch = Watch(concat_2)
