# Dynamo graph TestConcatString_invalidInput.dyn

string = StringInput("a")
split_string = SplitString(string, string)
concat_strings = ConcatStrings(string, split_string)
watch = Watch(concat_strings)
