# Dynamo graph TestConcatString_multipleInput.dyn (Dynamo 0.7.0.20803)

code_block = CodeBlock { {"ab","cd"}; {"ef","gh"}; }
concat = String.Concat(code_block.out0, code_block.out1)
watch = Watch(concat)
