# Dynamo graph TestConcatString_normal.dyn (Dynamo 1.0.1.1743)

string = StringInput("123")
string_2 = StringInput("abc ")
string_3 = StringInput("    !@#    ")
concat = String.Concat(string, string_2, string_3)
watch = Watch(concat)
