# Dynamo graph TestJoinStringUseLevelsOnVariadicPort.dyn (Dynamo 2.14.0.0)

code_block = CodeBlock { "-"; }
code_block_2 = CodeBlock { "x"; }
code_block_3 = CodeBlock { ["a","b"]; }
join = String.Join(separator=code_block@L1, string0=code_block_2, string1=code_block_3@L1)
