# Dynamo graph TestJoinString_fromFile.dyn (Dynamo 0.7.4.3075)

string = StringInput(".")
file_path = Filename("..\..\..\test\core\string\TestJoinString_fromFile.txt")
fromPath = FileObject(file_path)  # "File.FromPath"
readText = File.ReadText(fromPath)
string_2 = StringInput("x")
join = String.Join(string, readText, string_2)
watch = Watch(join)
