# Dynamo graph TestJoinString_normal.dyn (Dynamo 1.0.1.1743)

string = StringInput(".")
string_2 = StringInput("first")
string_3 = StringInput("second")
create_list = List.Create(string_2, string_3)
join = String.Join(string, create_list)
code_block = CodeBlock { 0; }
getItemAtIndex = List.GetItemAtIndex(list=join, index=code_block)
watch = Watch(getItemAtIndex)
