# Dynamo graph TestJoinString_singleInput.dyn (Dynamo 1.0.1.1743)

string = StringInput(".")
string_2 = StringInput("a")
join = String.Join(string, string_2)
code_block = CodeBlock { 0; }
getItemAtIndex = List.GetItemAtIndex(list=join, index=code_block)
watch = Watch(getItemAtIndex)
