# Dynamo graph TestLocalizedString.dyn (Dynamo 0.7.6.3990)

code_block = CodeBlock { x="中文"; }
watch = Watch(code_block)
string = StringInput("中文")
code_block_2 = CodeBlock(x=code_block, y=string) { x == y; }
watch_2 = Watch(code_block_2)
watch_3 = Watch(string)
