# Dynamo graph TestNumberToString_fromFunction.dyn (Dynamo 0.7.5.3233)

number = DoubleInput(12)
number_2 = DoubleInput(13)
add = number + number_2  # lacing=Longest
string_from_object = FromObject(add)
watch = Watch(string_from_object)
