# Dynamo graph TestNumberToString_normal.dyn (Dynamo 0.7.0.20811)

number = DoubleInput(123456789)
fromObject = String.FromObject(number, lacing=Longest)
toNumber = String.ToNumber(fromObject)
watch = Watch(toNumber)
number_2 = DoubleInput(-123456789)
fromObject_2 = String.FromObject(number_2, lacing=Longest)
toNumber_2 = String.ToNumber(fromObject_2)
watch_2 = Watch(toNumber_2)
number_3 = DoubleInput(3.456)
fromObject_3 = String.FromObject(number_3, lacing=Longest)
toNumber_3 = String.ToNumber(fromObject_3)
watch_3 = Watch(toNumber_3)
number_4 = DoubleInput(-3.456)
fromObject_4 = String.FromObject(number_4, lacing=Longest)
toNumber_4 = String.ToNumber(fromObject_4)
watch_4 = Watch(toNumber_4)
