# Dynamo graph TestNumberToString_normal_numericformat.dyn (Dynamo 3.4.0.6676)

number = DoubleInput(123456789)
code_block = CodeBlock { ["F3","F1","G","B"]; }
string_from_object_and_format = FormattedStringFromObject(object=number, formatSpecifier=code_block)
watch1 = Watch(string_from_object_and_format)
number_2 = DoubleInput(-123456789)
string_from_object_and_format_2 = FormattedStringFromObject(object=number_2, formatSpecifier=code_block)
watch2 = Watch(string_from_object_and_format_2)
number_3 = DoubleInput(3.46)
string_from_object_and_format_3 = FormattedStringFromObject(object=number_3, formatSpecifier=code_block)
watch3 = Watch(string_from_object_and_format_3)
code_block_2 = CodeBlock { {"key":"0.000000000"}; }
string_from_object2 = FormattedStringFromObject(object=code_block_2, useNumericFormat=code_block)
watch6 = Watch(string_from_object2)
number_4 = DoubleInput(-3.46)
string_from_object_and_format_4 = FormattedStringFromObject(object=number_4, formatSpecifier=code_block)
watch4 = Watch(string_from_object_and_format_4)
code_block_3 = CodeBlock { {"key":"5"}; }
string_from_object2_2 = FormattedStringFromObject(object=code_block_3, formatSpecifier=code_block)
watch7 = Watch(string_from_object2_2)
number_5 = DoubleInput(123456789)
string_from_object_and_format_5 = FormattedStringFromObject(object=number_5)
watch0 = Watch(string_from_object_and_format_5)
code_block_4 = CodeBlock { 5; }
string_from_object_and_format_6 = FormattedStringFromObject(object=code_block_4, formatSpecifier=code_block)
watch5 = Watch(string_from_object_and_format_6)
