# Dynamo graph TestObsoleteStringFunctions.dyn (Dynamo 0.7.5.3233)

code_block = CodeBlock { 42; }
toString = ToString(code_block)
watch = Watch(toString)
fromObject = String.FromObject(code_block)
watch_2 = Watch(fromObject)
