# Dynamo graph TestSplitString_fromFile.dyn (Dynamo 0.7.4.3075)

file_path = Filename("..\..\..\test\core\string\TestSplitString_fromFile.txt")
fromPath = FileObject(file_path)  # "File.FromPath"
readText = File.ReadText(fromPath)
string = StringInput(".")
split = String.Split(readText, string)
watch = Watch(split)
