# Dynamo graph TestSplitString_fromFunction.dyn (Dynamo 1.0.1.1743)

string = StringInput("1")
string_2 = StringInput(".2")
concat = String.Concat(string, string_2)
string_3 = StringInput(".")
split = String.Split(concat, string_3)
watch = Watch(split)
