# Dynamo graph TestSplitString_multipleInput.dyn (Dynamo 0.7.0.19237)

code_block = CodeBlock { "today.yesterday"; }
code_block_2 = CodeBlock { "tomorrow...and forever..."; }
create_list = List.Create(code_block, code_block_2)
code_block_3 = CodeBlock { "."; }
split = String.Split(create_list, code_block_3)
watch = Watch(split)
