# Dynamo graph TestStringCase_fromFile.dyn (Dynamo 0.7.4.3075)

file_path = Filename("..\..\..\test\core\string\TestStringCase_fromFile.txt")
fromPath = FileObject(file_path)  # "File.FromPath"
readText = File.ReadText(fromPath)
boolean = BoolSelector(true)
changeCase = String.ChangeCase(readText, boolean)
watch = Watch(changeCase)
