# Dynamo graph TestStringCase_fromFunction.dyn (Dynamo 1.0.1.1743)

string = StringInput("SUNNY")
string_2 = StringInput("day")
concat = String.Concat(string, string_2)
boolean = BoolSelector(true)
changeCase = String.ChangeCase(concat, boolean)
watch = Watch(changeCase)
