# Dynamo graph TestStringCase_normal.dyn (Dynamo 1.0.1.1743)

string = StringInput("Rainy Day")
boolean = BoolSelector(true)
changeCase = String.ChangeCase(string, boolean)
watch = Watch(changeCase)
string_2 = StringInput("Rainy Day")
boolean_2 = BoolSelector(false)
changeCase_2 = String.ChangeCase(string_2, boolean_2)
watch_2 = Watch(changeCase_2)
