# Dynamo graph TestStringContains_emptyString.dyn (Dynamo 1.0.1.1743)

code_block = CodeBlock { ""; }
code_block_2 = CodeBlock { "String"; }
boolean = BoolSelector(true)
contains = String.Contains(str=code_block, searchFor=code_block_2, ignoreCase=boolean)
watch = Watch(contains)
code_block_3 = CodeBlock { "This is the original string."; }
code_block_4 = CodeBlock { ""; }
boolean_2 = BoolSelector(true)
contains_2 = String.Contains(str=code_block_3, searchFor=code_block_4, ignoreCase=boolean_2)
watch_2 = Watch(contains_2)
