# Dynamo graph TestStringContains_invalidInput.dyn (Dynamo 1.0.1.1743)

code_block = CodeBlock { "This is the original string."; }
code_block_2 = CodeBlock { 123; }
boolean = BoolSelector(true)
contains = String.Contains(str=code_block, searchFor=code_block_2, ignoreCase=boolean)
watch = Watch(contains)
