# Dynamo graph TestStringContains_normal.dyn (Dynamo 1.0.1.1743)

code_block = CodeBlock { "This is the original string."; }
code_block_2 = CodeBlock { "String"; }
boolean = BoolSelector(true)
contains = String.Contains(str=code_block, searchFor=code_block_2, ignoreCase=boolean)
watch = Watch(contains)
boolean_2 = BoolSelector(false)
contains_2 = String.Contains(str=code_block, searchFor=code_block_2, ignoreCase=boolean_2)
watch_2 = Watch(contains_2)
code_block_3 = CodeBlock { "This is the original string."; }
code_block_4 = CodeBlock { "Contains"; }
boolean_3 = BoolSelector(false)
contains_3 = String.Contains(str=code_block_3, searchFor=code_block_4, ignoreCase=boolean_3)
watch_3 = Watch(contains_3)
boolean_4 = BoolSelector(true)
contains_4 = String.Contains(str=code_block_3, searchFor=code_block_4, ignoreCase=boolean_4)
watch_4 = Watch(contains_4)
