# Dynamo graph TestStringEndsWith_normal.dyn (Dynamo 0.7.0.26857)

code_block = CodeBlock { "This is the original string."; }
code_block_2 = CodeBlock { "this is"; }
boolean = BoolSelector(true)
endsWith = String.EndsWith(code_block, code_block_2, boolean)
watch = Watch(endsWith)
boolean_2 = BoolSelector(false)
endsWith_2 = String.EndsWith(code_block, code_block_2, boolean_2)
watch_2 = Watch(endsWith_2)
code_block_3 = CodeBlock { "This is the original string."; }
code_block_4 = CodeBlock { "String."; }
boolean_3 = BoolSelector(false)
endsWith_3 = String.EndsWith(code_block_3, code_block_4, boolean_3)
watch_3 = Watch(endsWith_3)
boolean_4 = BoolSelector(true)
endsWith_4 = String.EndsWith(code_block_3, code_block_4, boolean_4)
watch_4 = Watch(endsWith_4)
