# Dynamo graph TestStringFromArrayPreview_numericformat.dyn "TestFormattedStringFromArrayPreview_numericformat" (Dynamo 3.4.0.6676)

code_block = CodeBlock { 1..3..#4; }
string_from_array = FromArray(arr=code_block)
watch1 = Watch(string_from_array)
string_from_array2 = FormattedStringFromArray(array=code_block)  # unwired: useNumericFormat
watch4 = Watch(string_from_array2)
string_from_array_and_format = FormattedStringFromArray(array=code_block)
watch2 = Watch(string_from_array_and_format)
code_block_2 = CodeBlock { ["F1","G","B"]; }
string_from_array_and_format_2 = FormattedStringFromArray(array=code_block, formatSpecifier=code_block_2)
watch3 = Watch(string_from_array_and_format_2)
