# Dynamo graph TestStringIndexOf_emptyString.dyn (Dynamo 1.0.1.1743)

code_block = CodeBlock { ""; }
code_block_2 = CodeBlock { "String"; }
boolean = BoolSelector(true)
indexOf = String.IndexOf(string=code_block, searchFor=code_block_2, ignoreCase=boolean)
watch = Watch(indexOf)
code_block_3 = CodeBlock { "This is the original string."; }
code_block_4 = CodeBlock { ""; }
boolean_2 = BoolSelector(true)
indexOf_2 = String.IndexOf(string=code_block_3, searchFor=code_block_4, ignoreCase=boolean_2)
watch_2 = Watch(indexOf_2)
