# Dynamo graph TestStringIndexOf_multipleInput.dyn (Dynamo 0.7.0.26857)

code_block = CodeBlock { {"Today","Yesterday","Tomorrow"}; }
code_block_2 = CodeBlock { "day"; }
boolean = BoolSelector(false)
indexOf = String.IndexOf(code_block, code_block_2, boolean)
watch = Watch(indexOf)
code_block_3 = CodeBlock { "This is the original string."; }
code_block_4 = CodeBlock { {"a","e","i","o","u"}; }
boolean_2 = BoolSelector(true)
indexOf_2 = String.IndexOf(code_block_3, code_block_4, boolean_2)
watch_2 = Watch(indexOf_2)
