# Dynamo graph TestStringInsert_invalidInput.dyn (Dynamo 1.0.1.1743)

code_block = CodeBlock { "A string"; }
code_block_2 = CodeBlock { 20; }
code_block_3 = CodeBlock { " to insert."; }
insert = String.Insert(str=code_block, index=code_block_2, toInsert=code_block_3)
watch = Watch(insert)
