# Dynamo graph TestStringInsert_multipleInput.dyn (Dynamo 1.0.1.1743)

code_block = CodeBlock { "My name is ."; }
code_block_2 = CodeBlock { 11; }
code_block_3 = CodeBlock { {"Jude","Bryan","Dave"}; }
insert = String.Insert(str=code_block, index=code_block_2, toInsert=code_block_3)
watch = Watch(insert)
code_block_4 = CodeBlock { "Aaagh"; }
code_block_5 = CodeBlock { 1..3; }
code_block_6 = CodeBlock { "rrr"; }
insert_2 = String.Insert(str=code_block_4, index=code_block_5, toInsert=code_block_6)
watch_2 = Watch(insert_2)
