# Dynamo graph TestStringInsert_normal.dyn (Dynamo 1.0.1.1743)

code_block = CodeBlock { "is a string."; }
code_block_2 = CodeBlock { 0; }
code_block_3 = CodeBlock { "This "; }
insert = String.Insert(str=code_block, index=code_block_2, toInsert=code_block_3)
watch = Watch(insert)
code_block_4 = CodeBlock { 9; }
code_block_5 = CodeBlock { "nother"; }
insert_2 = String.Insert(str=insert, index=code_block_4, toInsert=code_block_5)
watch_2 = Watch(insert_2)
