# Dynamo graph TestStringLength_fromFunction.dyn (Dynamo 1.0.1.1743)

string = StringInput("a")
string_2 = StringInput("bc")
concat = String.Concat(string, string_2)
length = String.Length(concat)
watch = Watch(length)
