# Dynamo graph TestStringLength_multipleInput.dyn (Dynamo 1.0.1.1743)

string = StringInput("ab.cde")
string_2 = StringInput(".")
split = String.Split(string, string_2)
length = String.Length(split)
watch = Watch(length)
