# Dynamo graph TestStringReplace_emptyString.dyn (Dynamo 0.7.0.26857)

code_block = CodeBlock { "A String object's string content can be replaced by another string."; }
code_block_2 = CodeBlock { " string"; }
code_block_3 = CodeBlock { ""; }
replace = String.Replace(code_block, code_block_2, code_block_3)
watch = Watch(replace)
