# Dynamo graph TestStringReplace_multipleInput.dyn (Dynamo 1.0.1.1743)

code_block = CodeBlock { "I am going to meet Bryan and Dave."; }
code_block_2 = CodeBlock { {"Bryan","Dave"}; }
code_block_3 = CodeBlock { "him"; }
replace = String.Replace(str=code_block, searchFor=code_block_2, replaceWith=code_block_3)
watch = Watch(replace)
code_block_4 = CodeBlock { {"My name is Bryan.","Bryan is my name."}; }
code_block_5 = CodeBlock { "Bryan"; }
code_block_6 = CodeBlock { "Dave"; }
replace_2 = String.Replace(str=code_block_4, searchFor=code_block_5, replaceWith=code_block_6)
watch_2 = Watch(replace_2)
