# Dynamo graph TestStringReplace_normal.dyn (Dynamo 1.0.1.1743)

code_block = CodeBlock { "A String object's string content can be replaced by another string."; }
code_block_2 = CodeBlock { "string"; }
code_block_3 = CodeBlock { "text"; }
replace = String.Replace(str=code_block, searchFor=code_block_2, replaceWith=code_block_3)
watch = Watch(replace)
