# Dynamo graph TestStringStartsWith_normal.dyn (Dynamo 1.0.1.1743)

code_block = CodeBlock { "This is the original string."; }
code_block_2 = CodeBlock { "this is"; }
boolean = BoolSelector(true)
startsWith = String.StartsWith(str=code_block, searchFor=code_block_2, ignoreCase=boolean)
watch = Watch(startsWith)
boolean_2 = BoolSelector(false)
startsWith_2 = String.StartsWith(str=code_block, searchFor=code_block_2, ignoreCase=boolean_2)
watch_2 = Watch(startsWith_2)
code_block_3 = CodeBlock { "This is the original string."; }
code_block_4 = CodeBlock { "string."; }
boolean_3 = BoolSelector(false)
startsWith_3 = String.StartsWith(str=code_block_3, searchFor=code_block_4, ignoreCase=boolean_3)
watch_3 = Watch(startsWith_3)
boolean_4 = BoolSelector(true)
startsWith_4 = String.StartsWith(str=code_block_3, searchFor=code_block_4, ignoreCase=boolean_4)
watch_4 = Watch(startsWith_4)
