# Dynamo graph TestStringToNumber_fromFile.dyn (Dynamo 0.7.4.3075)

file_path = Filename("..\..\..\test\core\string\TestStringToNumber_fromFile.txt")
fromPath = FileObject(file_path)  # "File.FromPath"
readText = File.ReadText(fromPath)
toNumber = String.ToNumber(readText, lacing=Longest)
watch = Watch(toNumber)
