# Dynamo graph TestStringToNumber_fromFunction.dyn (Dynamo 1.0.1.1743)

string = StringInput("1")
string_2 = StringInput("2")
concat = String.Concat(string, string_2)
toNumber = String.ToNumber(concat, lacing=Longest)
watch = Watch(toNumber)
