# Dynamo graph TestStringToNumber_invalidInput.dyn (Dynamo 1.0.1.1743)

string = StringInput("abc")
string_2 = StringInput("b")
split = String.Split(string, string_2)
toNumber = String.ToNumber(split, lacing=Longest)
watch = Watch(toNumber)
