# Dynamo graph TestStringToNumber_normal.dyn (Dynamo 1.0.1.1743)

string = StringInput("12")
toNumber = String.ToNumber(string, lacing=Longest)
watch = Watch(toNumber)
string_2 = StringInput("12.3")
toNumber_2 = String.ToNumber(string_2, lacing=Longest)
watch_2 = Watch(toNumber_2)
string_3 = StringInput("1,000")
toNumber_3 = String.ToNumber(string_3, lacing=Longest)
watch_3 = Watch(toNumber_3)
string_4 = StringInput("123456789")
toNumber_4 = String.ToNumber(string_4, lacing=Longest)
watch_4 = Watch(toNumber_4)
