# Dynamo graph TestSubstring_emptyString.dyn (Dynamo 1.0.1.1743)

string = StringInput("")
number = DoubleInput(0)
number_2 = DoubleInput(0)
substring = String.Substring(str=string, startIndex=number, length=number_2)
watch = Watch(substring)
