# Dynamo graph TestSubstring_fromFile.dyn (Dynamo 0.7.4.3075)

file_path = Filename("..\..\..\test\core\string\TestSubstring_fromFile.txt")
fromPath = FileObject(file_path)  # "File.FromPath"
readText = File.ReadText(fromPath)
number = DoubleInput(4)
number_2 = DoubleInput(7)
substring = String.Substring(readText, number, number_2)
watch = Watch(substring)
