# Dynamo graph TestSubstring_fromFunction.dyn (Dynamo 1.0.1.1743)

string = StringInput("the ")
string_2 = StringInput("rainbow")
concat = String.Concat(string, string_2)
number = DoubleInput(4)
number_2 = DoubleInput(7)
substring = String.Substring(str=concat, startIndex=number, length=number_2)
watch = Watch(substring)
