# Dynamo graph TestSubstring_invalidInput.dyn (Dynamo 1.0.1.1743)

string = StringInput("rainbow")
number = DoubleInput(10)
number_2 = DoubleInput(1)
substring = String.Substring(str=string, startIndex=number, length=number_2)
watch = Watch(substring)
