# Dynamo graph TestSubstring_normal.dyn (Dynamo 1.0.1.1743)

string = StringInput("the rainbow")
number = DoubleInput(4)
number_2 = DoubleInput(7)
substring = String.Substring(str=string, startIndex=number, length=number_2)
watch = Watch(substring)
