# Dynamo graph TestToString_fromFile.dyn (Dynamo 4.0.0.2016)

file_path = Filename("..\..\..\test\core\string\TestToString_fromFile.txt")  # graph input
file_from_path = FileObject(path=file_path)
readText = FileSystem.ReadText(file=file_from_path)
string_from_object = FromObject(object=readText)
watch = Watch(string_from_object)
