# Dynamo graph TestToString_fromFunction.dyn (Dynamo 1.0.1.1743)

string = StringInput("123")
string_2 = StringInput("2")
split = String.Split(string, string_2)
fromObject = String.FromObject(split)
watch = Watch(fromObject)
