# Dynamo graph TestTrimWhitespace_emptyString.dyn (Dynamo 0.7.0.26857)

code_block = CodeBlock { ""; "\n"; "\t"; "   "; }
trimWhitespace = String.TrimWhitespace(code_block.out0)
length = String.Length(trimWhitespace)
watch = Watch(length)
trimWhitespace_2 = String.TrimWhitespace(code_block.out1)
length_2 = String.Length(trimWhitespace_2)
watch_2 = Watch(length_2)
trimWhitespace_3 = String.TrimWhitespace(code_block.out2)
length_3 = String.Length(trimWhitespace_3)
watch_3 = Watch(length_3)
trimWhitespace_4 = String.TrimWhitespace(code_block.out3)
length_4 = String.Length(trimWhitespace_4)
watch_4 = Watch(length_4)
