# Dynamo graph TestTrimWhitespace_multipleInput.dyn (Dynamo 0.7.0.26857)

code_block = CodeBlock()
# ---------- code_block.designscript (4 lines) ----------
{"123abc   ",
"   abc234   ",
"   345abc",
"   456   abc789   "};
# ----------------------------------------
trimWhitespace = String.TrimWhitespace(code_block)
watch = Watch(trimWhitespace)
