# Dynamo graph TestTrimWhitespace_normal.dyn (Dynamo 0.7.0.26857)

code_block = CodeBlock { "123abc   "; "   abc234   "; "   345abc"; "   456   abc789   "; }
trimWhitespace = String.TrimWhitespace(code_block.out0)
watch = Watch(trimWhitespace)
trimWhitespace_2 = String.TrimWhitespace(code_block.out1)
watch_2 = Watch(trimWhitespace_2)
trimWhitespace_3 = String.TrimWhitespace(code_block.out2)
watch_3 = Watch(trimWhitespace_3)
trimWhitespace_4 = String.TrimWhitespace(code_block.out3)
watch_4 = Watch(trimWhitespace_4)
