# Dynamo graph transpose.dyn

number = DoubleInput(0)
number_2 = DoubleInput(10)
number_3 = DoubleInput(1)
number_sequence = BuildSeq(number, number_2, number_3, lacing=Longest)
add = Addition(number_sequence, number_2, lacing=Longest)
number_4 = DoubleInput(2)
number_sequence_2 = BuildSeq(number_sequence, add, number_4, lacing=Longest)
watch = Watch(number_sequence_2)
transpose_lists = Transpose(number_sequence_2)
watch_2 = Watch(transpose_lists)
