# Dynamo graph unicodeInCBN.dyn (Dynamo 0.7.6.4024)

code_block = CodeBlock { π１=3; 半径１=4; めんせき１=π１*Math.Pow(半径１,2); }
watch = Watch(code_block.めんせき１)
code_block_2 = CodeBlock()
# ---------- code_block_2.designscript (6 lines) ----------
def めんせき(半径,π)
{
    return =π*Math.Pow(半径,2);
};
area1 = めんせき(2, 3);
area2 = めんせき(3, 3);
# ----------------------------------------
watch_2 = Watch(code_block_2.out0)
watch_3 = Watch(code_block_2.out1)
