# Dynamo graph unicodeInIronpython.dyn (Dynamo 0.7.6.4073)

python_script = Python()
# ---------- python_script.python (9 lines) ----------
import clr
clr.AddReference('ProtoGeometry')
from Autodesk.DesignScript.Geometry import *
#The inputs to this node will be stored as a list in the IN variable.
dataEnteringNode = IN

#Assign your output to the OUT variable
中文 = "中文字符123"
OUT = 中文
# ----------------------------------------
watch = Watch(python_script)
length = String.Length(python_script)
watch_2 = Watch(length)
