# Dynamo graph malformed_unit_dropdowns.dyn "malformed_unit_nodes" (Dynamo 2.13.0.3196)

n4 = Symbols("Millimeters: mm")  # "4"
n5 = Units("Millimeters AAA")  # "5"
code_block = CodeBlock { 5; }
n6 = Units("Meters")  # "6"
n7 = Units("Millimeters")  # "7"
n2 = DynamoUnits.Utilities.ConvertByUnits(value=code_block, fromUnit=n6, toUnit=n7)  # "2"
n1 = DynamoUnitConvert(code_block, MeasurementType="autodesk.unit.quantity", FromConversion="autodesk.unit.unit:", ToConversion="autodesk.unit.unit:")  # "1"
n3 = Quantities("Force AAA")  # "3"
n8 = DynamoUnits.Quantity.Units(quantity=n3)  # "8"
