# Dynamo graph CreateMeshUsingGeometryAndQueryAllProperties.dyn (Dynamo 1.2.1.2872)

origin = Point.Origin()
code_block = CodeBlock { 2; }
byCoordinates = Point.ByCoordinates(x=code_block, y=code_block)
code_block_2 = CodeBlock { 0.5; }
byPointsRadius = Cylinder.ByPointsRadius(origin, byCoordinates, code_block_2)
byCenterPointRadius = Sphere.ByCenterPointRadius(centerPoint=byCoordinates)
byLengths = Cuboid.ByLengths()
code_block_3 = CodeBlock(b=byPointsRadius, c=byCenterPointRadius, d=byLengths) { {b,c, d}; }
byUnion = Solid.ByUnion(code_block_3)
byGeometry = Autodesk.Dynamo.MeshToolkit.Mesh.ByGeometry(byUnion)
vertexCount = Autodesk.Dynamo.MeshToolkit.Mesh.VertexCount(byGeometry)
code_block_4 = CodeBlock { 0; }
gt = vertexCount > code_block_4
triangleCount = Autodesk.Dynamo.MeshToolkit.Mesh.TriangleCount(byGeometry)
gt_2 = triangleCount > code_block_4
edgeCount = Autodesk.Dynamo.MeshToolkit.Mesh.EdgeCount(byGeometry)
gt_3 = edgeCount > code_block_4
