# Dynamo graph SliceMesh.dyn (Dynamo 0.8.2.1941)

identity = CoordinateSystem.Identity()
code_block = CodeBlock(WCS=identity)
# ---------- code_block.designscript (10 lines) ----------
p1 = Autodesk.Point.ByCartesianCoordinates(WCS, 7.5, 5, 7.5);
p2 = Autodesk.Point.ByCartesianCoordinates(WCS, 5, 10, 7.5);
p3 = Autodesk.Point.ByCartesianCoordinates(WCS, 7.5, 15, 7.5);
p4 = Autodesk.Point.ByCartesianCoordinates(WCS, 10, 10, 7.5);
p5 = Autodesk.Point.ByCartesianCoordinates(WCS, 7.5, 10, 5);
p6 = Autodesk.Point.ByCartesianCoordinates(WCS, 7.5, 10, 10);
{ p1, p2, p3, p4, p5, p6 };
faceIndices = { { 0, 1, 4 }, { 0, 4, 3 }, { 0, 1, 5 }, { 0, 5, 3 }, { 4, 1, 2 }, { 4, 2, 3 },
{ 1, 2, 5 }, { 5, 2, 3 } };
//vertices = vertices.Translate(20, 0, 0);
# ----------------------------------------
byVerticesAndIndices = Autodesk.Dynamo.MeshToolkit.Mesh.ByVerticesAndIndices(code_block.out6, code_block.faceIndices)
code_block_2 = CodeBlock { Autodesk.Point.ByCoordinates(7.5,12,7.5); }
XAxis = Vector.XAxis()
byOriginNormal = Plane.ByOriginNormal(origin=code_block_2, normal=XAxis)
intersect = Autodesk.Dynamo.MeshToolkit.Mesh.Intersect(byVerticesAndIndices, byOriginNormal)
flatten = Flatten(intersect)
code_block_3 = CodeBlock { null; }
eq = flatten == code_block_3
filterByBoolMask = List.FilterByBoolMask(list=flatten, mask=eq)
code_block_4 = CodeBlock(allCurves=filterByBoolMask.out) { allCurves; }
