# Dynamo custom node List.SortByKeyList.dyf (Dynamo 0.7.4.3245)
# category: Core.List.Actions
# Reorder a list according to the sorted order of a second key list.

# note: Reorder items in the list by the sorted order of the keyList.
keyList = Input()
list = Input()
python_script = Python(IN[0]=keyList, IN[1]=list)
# ---------- python_script.python (25 lines) ----------
import clr
clr.AddReference('ProtoGeometry')
from Autodesk.DesignScript.Geometry import *

keys = IN[0]
ls = IN[1]

for slot in range(len(keys)-1, 0, -1):
	positionOfMax = 0
	
	for location in range(1, slot+1):
		if keys[location] > keys[positionOfMax]:
			positionOfMax = location

	temp = keys[slot]
	keys[slot] = keys[positionOfMax]
	keys[positionOfMax] = temp
	
	temp2 = ls[slot]
	ls[slot] = ls[positionOfMax]
	ls[positionOfMax] = temp2

OUT = []
OUT.append(keys)
OUT.append(ls)
# ----------------------------------------
code_block = CodeBlock(OUT=python_script) { OUT[0]; OUT[1]; }
keyList_2 = Output(code_block.out0)  # "keyList"
list_2 = Output(code_block.out1)  # "list"
