# Dynamo graph CreateMeshUsingVerticesAndFaceIndices.dyn (Dynamo 0.8.2.1957)

identity = CoordinateSystem.Identity()
code_block = CodeBlock(WCS=identity)
# ---------- code_block.designscript (9 lines) ----------
p1 = Autodesk.Point.ByCartesianCoordinates(WCS, 7.5, 5, 7.5);
p2 = Autodesk.Point.ByCartesianCoordinates(WCS, 5, 10, 7.5);
p3 = Autodesk.Point.ByCartesianCoordinates(WCS, 7.5, 15, 7.5);
p4 = Autodesk.Point.ByCartesianCoordinates(WCS, 10, 10, 7.5);
p5 = Autodesk.Point.ByCartesianCoordinates(WCS, 7.5, 10, 5);
p6 = Autodesk.Point.ByCartesianCoordinates(WCS, 7.5, 10, 10);
{ p1, p2, p3, p4, p5, p6 };
faceIndices = {  0, 1, 4, 0, 4, 3, 0, 1, 5, 0, 5, 3, 4, 1, 2, 4, 2, 3,1, 2, 5, 5, 2, 3};
//vertices = vertices.Translate(20, 0, 0);
# ----------------------------------------
watch = Watch(code_block.out6)
byVerticesAndIndices = Autodesk.Dynamo.MeshToolkit.Mesh.ByVerticesAndIndices(code_block.out6, code_block.faceIndices)
makeWatertight = Autodesk.Dynamo.MeshToolkit.Mesh.MakeWatertight(byVerticesAndIndices)
XY = Plane.XY()
mirror = Autodesk.Dynamo.MeshToolkit.Mesh.Mirror(byVerticesAndIndices, XY)
XAxis = Vector.XAxis()
code_block_2 = CodeBlock { 90; }
rotate = Autodesk.Dynamo.MeshToolkit.Mesh.Rotate(byVerticesAndIndices, XAxis, code_block_2)
code_block_3 = CodeBlock { 2; }
scale = Autodesk.Dynamo.MeshToolkit.Mesh.Scale(byVerticesAndIndices, code_block_3)
triangles = Autodesk.Dynamo.MeshToolkit.Mesh.Triangles(byVerticesAndIndices)
vertices = Autodesk.Dynamo.MeshToolkit.Mesh.Vertices(byVerticesAndIndices)
