# Dynamo graph BasicTextTest.dyn (Dynamo 0.8.1.1316)

code_block = CodeBlock { "Hello Word Dynamo"; }
code_block_2 = CodeBlock { Point.ByCoordinates(4,4,0); }
code_block_3 = CodeBlock { 2; }
fromStringOriginAndScale = DynamoText.Text.FromStringOriginAndScale(code_block, code_block_2, code_block_3)
code_block_4 = CodeBlock { Vector.ZAxis(); }
extrude = Curve.Extrude(curve=fromStringOriginAndScale, direction=code_block_4)
code_block_5 = CodeBlock { 0.2; }
thicken = Surface.Thicken(surface=extrude, thickness=code_block_5)
