# Dynamo graph packageTest.dyn (Dynamo 0.8.1.1311)

code_block = CodeBlock { {1,2,3}; }
code_block_2 = CodeBlock { {1,2,3}; }
sortByKeyList = Custom[List.SortByKeyList](keyList=code_block, list=code_block_2)  # Reorder a list according to the sorted order of a second key list.
code_block_3 = CodeBlock(list=sortByKeyList.list) { list; }
