# Dynamo graph ASM_Watch3D_MultipleInPorts.dyn (Dynamo 2.18.0.2986)

byCoordinates = Point.ByCoordinates()
code_block = CodeBlock { 10; }
byCoordinates_2 = Point.ByCoordinates(x=code_block)
watch_3d = Watch3D(byCoordinates, arg2=byCoordinates_2)  # unwired: arg1, arg3
