# Dynamo graph ASM_coordinateSystem.dyn (Dynamo 0.6.3.34783)

number = DoubleInput(0)
point = Point3DNode(number, number, number, lacing=Longest)
number_2 = DoubleInput(1)
vector = VectorNode(number_2, number, number, lacing=Longest)
vector_2 = VectorNode(number, number_2, number, lacing=Longest)
coordinateSystem = CoordinateSystemNode(point, vector, vector_2, lacing=Longest)
watch_3d = Watch3D(coordinateSystem)
