# Dynamo graph ASM_cuboid.dyn (Dynamo 0.7.0.24003)

number = DoubleInput(0)
point = Point3DNode(number, number, number, lacing=Longest)
number_2 = DoubleInput(1)
number_3 = DoubleInput(0)
vector = VectorNode(number_2, number_3, number_3, lacing=Longest)
vector_2 = VectorNode(number_3, number_2, number_3, lacing=Longest)
coordinateSystem = CoordinateSystemNode(point, vector, vector_2, lacing=Longest)
number_4 = DoubleInput(5)
cuboid = CuboidNode(coordinateSystem, number_4, number_4, number_4, lacing=Longest)
watch_3d = Watch3D(cuboid)
