# Dynamo graph ASM_extrusion.dyn (Dynamo 0.7.0.24003)

number = DoubleInput(0..9)
number_2 = DoubleInput(0)
number_3 = DoubleInput(-3.14..3.14..#10)
number_4 = DoubleInput(2)
formula = Formula("sin(x)*scale", x=number_3, scale=number_4, lacing=Longest)
point = Point3DNode(number, number_2, formula, lacing=Longest)
number_5 = DoubleInput(10)
point_2 = Point3DNode(number, number_5, formula, lacing=Longest)
list = NewList(index0=point, index1=point_2)
BSplineCurve = BSplineCurveNode(list, lacing=Longest)
loft = LoftNode(BSplineCurve, lacing=Longest)
number_6 = DoubleInput(1)
thicken_surface = ThickenSurfaceNode(loft, number_6, lacing=Longest)
watch_3d = Watch3D(thicken_surface)
