# Dynamo graph ASM_loft.dyn (Dynamo 0.8.2.1957)

origin = Point.Origin()
number = DoubleInput(2)
number_2 = DoubleInput(0)
number_3 = DoubleInput(120)
ZAxis = Vector.ZAxis()
byCenterPointRadiusAngle = Arc.ByCenterPointRadiusAngle(center=origin, radius=number, startAngle=number_2, endAngle=number_3, normal=ZAxis)
identity = CoordinateSystem.Identity()
code_block = CodeBlock()
# ---------- code_block.designscript (2 lines) ----------
o1=Autodesk.DesignScript.Geometry.Point.ByCoordinates(0,0,0);
o2=Autodesk.DesignScript.Geometry.Point.ByCoordinates(5,0,0);
# ----------------------------------------
YAxis = Vector.YAxis()
byOriginVectors = CoordinateSystem.ByOriginVectors(origin=code_block.o2, xAxis=YAxis, yAxis=ZAxis)
transform = Geometry.Transform(geometry=byCenterPointRadiusAngle, fromCoordinateSystem=identity, contextCoordinateSystem=byOriginVectors)
byOriginVectors_2 = CoordinateSystem.ByOriginVectors(origin=code_block.o1, xAxis=YAxis, yAxis=ZAxis)
transform_2 = Geometry.Transform(geometry=byCenterPointRadiusAngle, fromCoordinateSystem=identity, contextCoordinateSystem=byOriginVectors_2)
create = List.Create(transform, transform_2)
byLoft = Surface.ByLoft(create)
