# Dynamo graph ASM_points.dyn (Dynamo 0.8.2.1957)

number = DoubleInput(0..5)
number_2 = DoubleInput(0)
byCoordinates = Point.ByCoordinates(x=number, y=number_2, z=number_2)
watch_3d = Watch3D(byCoordinates)
