# Dynamo graph ASM_points_line.dyn (Dynamo 0.7.0.42298)

code_block = CodeBlock { 0; }
byCoordinates = Point.ByCoordinates(code_block, code_block, code_block)
code_block_2 = CodeBlock { 2; }
code_block_3 = CodeBlock { 0..5; }
byCoordinates_2 = Point.ByCoordinates(code_block, code_block_2, code_block_3)
byStartPointEndPoint = Line.ByStartPointEndPoint(byCoordinates, byCoordinates_2)
watch_3d = Watch3D(byStartPointEndPoint)
