# Dynamo graph ASM_points_line_noPreview.dyn (Dynamo 0.8.2.1957)

code_block = CodeBlock { 0; }
byCoordinates = Point.ByCoordinates(x=code_block, y=code_block, z=code_block)
code_block_2 = CodeBlock { 2; }
code_block_3 = CodeBlock { 0..5; }
byCoordinates_2 = Point.ByCoordinates(x=code_block, y=code_block_2, z=code_block_3)
byStartPointEndPoint = Line.ByStartPointEndPoint(startPoint=byCoordinates, endPoint=byCoordinates_2)
watch_3d = Watch3D(byStartPointEndPoint)
