# Dynamo graph ASM_python.dyn (Dynamo 0.6.3.13053)

number = DoubleInput(0)
number_2 = DoubleInput(0)
number_3 = DoubleInput(0)
list = NewList(index0=number, index1=number_2, index2=number_3)
number_4 = DoubleInput(0..10)
number_5 = DoubleInput(-3.14..3.14..#11)
formula = Formula("sin(y)", y=number_5, lacing=Longest)
number_6 = DoubleInput(0)
point = Point3DNode(number_4, formula, number_6, lacing=Longest)
number_7 = DoubleInput(5)
point_2 = Point3DNode(number_4, formula, number_7, lacing=Longest)
list_2 = NewList(index0=list, index1=point, index2=point_2)
python_script = Python(list_2)
# ---------- python_script.python (28 lines) ----------
# Default imports
import sys
import clr
path = r'C:\Autodesk\Dynamo\Core'
exec_path = r'C:\Users\Ian\Documents\GitHub\Dynamo\bin\AnyCPU\Debug\dll'
sys.path.append(path)
sys.path.append(exec_path)
clr.AddReference('LibGNet')
from Autodesk.LibG import *

#The input to this node will be stored in the IN variable.
dataEnteringNode = IN

coord = IN[0]
crvPtsA = IN[1]
crvPtsB = IN[2]

testPoints = []
testPoint = Point.by_coordinates(coord[0], coord[1], coord[2])
testPoints.append(testPoint)

testCurveA = BSplineCurve.by_points(PointList(crvPtsA))
testCurveB = BSplineCurve.by_points(PointList(crvPtsB))

testSurf = Surface.loft_by_cross_sections(CurveList([testCurveA,testCurveB]))

#Assign your output to the OUT variable
OUT = [testPoint, testCurveA, testCurveB, testSurf]
# ----------------------------------------
watch_3d = Watch3D(python_script)
watch = Watch(python_script)
