# Dynamo graph CBN.dyn (Dynamo 0.7.0.37559)

code_block = CodeBlock()
# ---------- code_block.designscript (5 lines) ----------
pt1 = Point.ByCoordinates(1,1,1);
pt2 = Point.ByCoordinates(5,5,5);
Sphere.ByCenterPointRadius(pt2,0.2);
Circle.ByCenterPointRadius(pt1,3);
Line.ByStartPointEndPoint(pt1,pt2);
# ----------------------------------------
