# Dynamo graph Display.ByGeometryColor.dyn (Dynamo 0.8.2.1465)

byLengths = Cuboid.ByLengths()
code_block = CodeBlock { Color.ByARGB(255,255,0,255); }
byGeometryColor = Display.Display.ByGeometryColor(byLengths, code_block)
