# Dynamo graph Display.ByGeometryColorPointsLines.dyn (Dynamo 2.6.0.7393)

byCenterPointRadius = Sphere.ByCenterPointRadius()
code_block = CodeBlock { 0..30; }
byCoordinates = Point.ByCoordinates(x=code_block, y=code_block, z=code_block, lacing=CrossProduct)
flatten = List.Flatten(list=byCoordinates)
color_palette = ColorPalette({R: 0, G: 0, B: 255, A: 255})
color_palette_2 = ColorPalette({R: 255, G: 255, B: 0, A: 255})
list_create = List.Create(item0=color_palette, item1=color_palette_2)
code_block_2 = CodeBlock { 0..1; }

# group: round down the index values so we can count the colors easily in tests.
count = List.Count(list=flatten)
code_block_3 = CodeBlock(x=count) { 0..x; }
code_block_4 = CodeBlock { 0; }
code_block_5 = CodeBlock { 1; }
remapRange = Math.RemapRange(numbers=code_block_3, newMin=code_block_4, newMax=code_block_5)
round = Math.Round(number=remapRange)

color_range = ColorRange(colors=list_create, indices=code_block_2, value=round)
byGeometryColor = Modifiers.GeometryColor.ByGeometryColor(geometry=flatten, color=color_range)
code_block_6 = CodeBlock { 20; }
translate = Geometry.Translate(geometry=byCoordinates, xTranslation=code_block_6, yTranslation=code_block_6)
byStartPointEndPoint = Line.ByStartPointEndPoint(startPoint=byCoordinates, endPoint=translate)
flatten_2 = List.Flatten(list=byStartPointEndPoint)
byGeometryColor_2 = Modifiers.GeometryColor.ByGeometryColor(geometry=flatten_2, color=color_range)
