# Dynamo graph Display.ByGeometryColorPoints_Selection.dyn (Dynamo 2.6.0.7706)

code_block = CodeBlock { x = 20..30; Point.ByCoordinates(x<1>,x<2>,x<3>); }
color_palette = ColorPalette({R: 0, G: 255, B: 0, A: 255})
green = Modifiers.GeometryColor.ByGeometryColor(geometry=code_block.out1, color=color_palette)
code_block_2 = CodeBlock { 10..15; }
byCoordinates = Point.ByCoordinates(x=code_block_2, y=code_block_2, z=code_block_2, lacing=CrossProduct)
color_palette_2 = ColorPalette({R: 255, G: 0, B: 0, A: 255})
red = Modifiers.GeometryColor.ByGeometryColor(geometry=byCoordinates, color=color_palette_2)
