# Dynamo graph Display.BySurfaceColors.dyn (Dynamo 0.8.2.1957)

byWidthLength = Rectangle.ByWidthLength()
byPatch = Surface.ByPatch(byWidthLength)
number = DoubleInput(0..255..5)
code_block = CodeBlock(input=number) { Color.ByARGB(255,input<1>,input<2>,0); }
bySurfaceColors = Display.Display.BySurfaceColors(byPatch, code_block)
