# Dynamo graph Display.MultipleTextureMaps.dyn (Dynamo 2.11.0.4780)

code_block = CodeBlock { Point.ByCoordinates(12,0); Point.ByCoordinates(20,0); }
byStartPointEndPoint = Line.ByStartPointEndPoint(startPoint=code_block.out0, endPoint=code_block.out1)
YAxis = Vector.YAxis()
code_block_2 = CodeBlock { 14; }
scale = Vector.Scale(vector=YAxis, scale_factor=code_block_2)
extrude = Curve.Extrude(curve=byStartPointEndPoint, direction=scale)
code_block_3 = CodeBlock { Point.ByCoordinates(0,0); Point.ByCoordinates(10,0); }
byStartPointEndPoint_2 = Line.ByStartPointEndPoint(startPoint=code_block_3.out0, endPoint=code_block_3.out1)
YAxis_2 = Vector.YAxis()
code_block_4 = CodeBlock { 10; }
scale_2 = Vector.Scale(vector=YAxis_2, scale_factor=code_block_4)
extrude_2 = Curve.Extrude(curve=byStartPointEndPoint_2, direction=scale_2)
list_create = List.Create(item0=extrude, item1=extrude_2)
code_block_5 = CodeBlock { 255; 0..200..50; 200; }
byARGB = Color.ByARGB(a=code_block_5.out0, r=code_block_5.out1, g=code_block_5.out1, b=code_block_5.out2, lacing=CrossProduct)
code_block_6 = CodeBlock { 255; 0..200..25; 150; }
byARGB_2 = Color.ByARGB(a=code_block_6.out0, r=code_block_6.out1, g=code_block_6.out2, b=code_block_6.out1, lacing=CrossProduct)
list_create_2 = List.Create(item0=byARGB, item1=byARGB_2)
bySurfaceColors = Modifiers.GeometryColor.BySurfaceColors(surface=list_create, colors=list_create_2)
firstItem = List.FirstItem(list=bySurfaceColors)
byCenterPointRadius = Circle.ByCenterPointRadius()
byPatch = Surface.ByPatch(closedCurve=byCenterPointRadius)
code_block_7 = CodeBlock { 255; 99; 71; }
byARGB_3 = Color.ByARGB(a=code_block_7.out0, r=code_block_7.out0, g=code_block_7.out1, b=code_block_7.out2)
byGeometryColor = Modifiers.GeometryColor.ByGeometryColor(geometry=byPatch, color=byARGB_3)
lastItem = List.LastItem(list=bySurfaceColors)
list_create_3 = List.Create(item0=firstItem, item1=byGeometryColor, item2=lastItem)
