# Dynamo graph Display.OneGeometryPerNode.dyn (Dynamo 2.11.0.3771)

code_block = CodeBlock { 0..8..2; 5; }
byCoordinates = Point.ByCoordinates(x=code_block.out0, y=code_block.out1)
byCoordinates_2 = Point.ByCoordinates()
byStartPointEndPoint = Line.ByStartPointEndPoint(startPoint=byCoordinates, endPoint=byCoordinates_2)
byLengths = Cuboid.ByLengths(origin=byCoordinates)
