# Dynamo graph FirstRunWatch3D.dyn (Dynamo 2.18.0.4710)

number = DoubleInput(10)  # graph input
byCoordinates = Point.ByCoordinates(x=number, y=number, z=number)
byCorners = Cuboid.ByCorners(highPoint=byCoordinates)
watch_3d = Watch3D(byCorners)
