# Dynamo graph LacingStrategyCodeBlockNodes.dyn "DYN-2381 CBN Lacing Multiplication" (Dynamo 2.8.0.2471)

code_block = CodeBlock { 1..10; }
code_block_2 = CodeBlock { 1..2; }
mul = code_block * code_block_2
code_block_3 = CodeBlock(x=code_block, y=code_block_2) { x*y; }
