# Dynamo graph LacingStrategyDisabled.dyn (Dynamo 2.10.0.3355)

code_block = CodeBlock { 1..10; }
code_block_2 = CodeBlock { 1..2; }
mul = code_block * code_block_2
code_block_3 = CodeBlock(x=code_block, y=code_block_2) { x*y; }
python_script = Python(IN[0]=code_block_2)  # CPython3; starter script, not edited (OUT = 0)
