# Dynamo graph MAGN_3815.dyn (Dynamo 1.0.1.1743)

code_block = CodeBlock { 0..100..10; }
byCoordinates = Point.ByCoordinates(x=code_block, y=code_block, lacing=CrossProduct)
watch = Watch(byCoordinates)
