# Dynamo graph MixedListOfInstancedAndStandardCurves.dyn "MixedListOfInstancedAndStandardCurvesExample1" (Dynamo 3.3.0.5237)

code_block = CodeBlock { 5; 10; 15; }
byCoordinates = Point.ByCoordinates(x=code_block.out1, y=code_block.out2)
byCoordinates_2 = Point.ByCoordinates(x=code_block.out2)
byStartPointEndPoint = Line.ByStartPointEndPoint(startPoint=byCoordinates, endPoint=byCoordinates_2)
byWidthLength = Rectangle.ByWidthLength(length=code_block.out0)
byCoordinates_3 = Point.ByCoordinates()
byCoordinates_4 = Point.ByCoordinates(x=code_block.out0)
byStartPointEndPoint_2 = Line.ByStartPointEndPoint(startPoint=byCoordinates_3, endPoint=byCoordinates_4)
list_create = List.Create(item0=byStartPointEndPoint, item1=byWidthLength, item2=byStartPointEndPoint_2, item3=byWidthLength, item4=byStartPointEndPoint_2)
byCenterPointRadius = Circle.ByCenterPointRadius()
regularPolygon = Polygon.RegularPolygon(circle=byCenterPointRadius)
