# Dynamo graph MultipleTextureMaps.dyn (Dynamo 2.17.0.3117)

XY = Plane.XY()
code_block = CodeBlock { 10; }
byWidthLength = Rectangle.ByWidthLength(plane=XY, width=code_block, length=code_block)
byPatch = Surface.ByPatch(closedCurve=byWidthLength)
code_block_2 = CodeBlock { 255; 0..200..50; 200; }
byARGB = Color.ByARGB(red=code_block_2.out1, green=code_block_2.out1, blue=code_block_2.out2, lacing=CrossProduct)
bySurfaceColors = Modifiers.GeometryColor.BySurfaceColors(surface=byPatch, colors=byARGB)
byCenterPointRadius = Circle.ByCenterPointRadius()
byPatch_2 = Surface.ByPatch(closedCurve=byCenterPointRadius)
code_block_3 = CodeBlock { 255; 99; 71; }
byARGB_2 = Color.ByARGB(alpha=code_block_3.out0, red=code_block_3.out0, green=code_block_3.out1, blue=code_block_3.out2)
byGeometryColor = Modifiers.GeometryColor.ByGeometryColor(geometry=byPatch_2, color=byARGB_2)
translate = Geometry.Translate(geometry=byPatch, xTranslation=code_block)
code_block_4 = CodeBlock { 255; 0..200..25; 150; }
byARGB_3 = Color.ByARGB(alpha=code_block_4.out0, red=code_block_4.out1, green=code_block_4.out2, blue=code_block_4.out1, lacing=CrossProduct)
bySurfaceColors_2 = Modifiers.GeometryColor.BySurfaceColors(surface=translate, colors=byARGB_3)
code_block_5 = CodeBlock { 4..12..3; }
byCoordinates = Point.ByCoordinates(x=code_block_5)
byLengths = Cuboid.ByLengths(origin=byCoordinates)
list_create = List.Create(item0=bySurfaceColors, item1=byGeometryColor, item2=bySurfaceColors_2, item3=byLengths)
