# Dynamo graph NaN.dyn (Dynamo 2.9.0.2326)

python_script = Python(AvailableEngines=[1, 2, 1, 2, 1, 2, 1, 2, 1, 2])  # CPython3; unwired: IN[0]
# ---------- python_script.python (2 lines) ----------
from System import Double
OUT = Double.NaN
# ----------------------------------------
naN = FFITarget.CustomLabel.ByCoordinatesAndString(x=python_script)
python_script_2 = Python(AvailableEngines=[1, 2, 1, 2, 1, 2])  # CPython3; unwired: IN[0]
# ---------- python_script_2.python (2 lines) ----------
from System import Double
OUT = Double.NegativeInfinity
# ----------------------------------------
negativeInfinity = FFITarget.CustomLabel.ByCoordinatesAndString(y=python_script_2)
python_script_3 = Python(AvailableEngines=[1, 2, 1, 2, 1, 2])  # CPython3; unwired: IN[0]
# ---------- python_script_3.python (2 lines) ----------
from System import Double
OUT = Double.PositiveInfinity
# ----------------------------------------
positiveInfinity = FFITarget.CustomLabel.ByCoordinatesAndString(z=python_script_3)
