# Dynamo graph PerformanceTestOnLabelsAfterHelixUpgrade.dyn "spehere-labels" (Dynamo 2.6.0.7787)

code_block = CodeBlock { 1..100; }
byCoordinates = Point.ByCoordinates(x=code_block)
byCenterPointRadius = Sphere.ByCenterPointRadius(centerPoint=byCoordinates)
watch = Watch(byCenterPointRadius)
