# Dynamo graph Planes.dyn (Dynamo 0.8.1.1177)

code_block = CodeBlock()
# ---------- code_block.designscript (5 lines) ----------
a=Autodesk.Point.ByCoordinates(0,0,0);
b=Autodesk.Point.ByCoordinates(5,-1,1);
c=Autodesk.Point.ByCoordinates(12,2,-1);
d=Autodesk.Point.ByCoordinates(20,1,10);
pts={a,b,c,d};
# ----------------------------------------
number = DoubleInput(3)
byPoints = NurbsCurve.ByPoints(code_block.pts, number)
number_of_planes = DoubleInput(5)
number_2 = DoubleInput(0..1..#count, number_of_planes, lacing=Longest)
planeAtParameter = Curve.PlaneAtParameter(curve=byPoints, param=number_2)
