# Dynamo custom node Points.dyf (Dynamo 1.0.1.1743)
# category: Ian

number_of_points = Input()
number = DoubleInput(0..a, number_of_points, lacing=Longest)
code_block = CodeBlock { 0; }
byCoordinates = Point.ByCoordinates(x=number, y=code_block, z=code_block)
pts = Output(byCoordinates)
