# Dynamo graph PreviewGlobal.dyn (Dynamo 0.8.2.1957)

originCodeBlock = CodeBlock { -5; 5; }
point0 = Point.ByCoordinates(x=originCodeBlock.out0)
point1 = Point.ByCoordinates(x=originCodeBlock.out1)
point2 = Point.ByCoordinates(x=originCodeBlock.out1, y=originCodeBlock.out1)
