# Dynamo graph PreviewUpstream.dyn (Dynamo 0.8.1.961)

originCodeBlock = CodeBlock { -5.5; 5.5; 0.5; }
point0 = Point.ByCoordinates(x=originCodeBlock.out0, y=originCodeBlock.out2)
point1 = Point.ByCoordinates(x=originCodeBlock.out1, y=originCodeBlock.out2)
line0 = Line.ByStartPointEndPoint(startPoint=point0, endPoint=point1)
arrayCodeBlock = CodeBlock { {0.33, 0.66}; }
finalPoints = Curve.PointAtParameter(curve=line0, param=arrayCodeBlock)
point2 = Point.ByCoordinates(x=originCodeBlock.out1, y=originCodeBlock.out1)
line1 = Line.ByStartPointEndPoint(startPoint=point1, endPoint=point2)
