# Dynamo custom node FiveCubes.dyf "Five Cubes" (Dynamo 0.9.1.2957)
# category: Ian
# A node that creates 5 cubes.

count = Input()
offset = Input()
code_block = CodeBlock(count=count, y=offset) { Point.ByCoordinates(0..count-1,y,0); }
size = Input(size:double=0.1)
byLengths = Cuboid.ByLengths(origin=code_block, width=size, length=size, height=size)
Cubes = Output(byLengths)
ZAxis = Vector.ZAxis()
code_block_2 = CodeBlock(s=size) { s*2; }
byStartPointDirectionLength = Line.ByStartPointDirectionLength(startPoint=code_block, direction=ZAxis, length=code_block_2)
Lines = Output(byStartPointDirectionLength)
Points = Output(code_block)
