# Dynamo custom node Sphere.dyf (Dynamo 0.9.1.2957)
# category: Ian
# Custom node which creates a sphere.

code_block = CodeBlock { Point.ByCoordinates(5,5,5); 3; }
byCenterPointRadius = Sphere.ByCenterPointRadius(centerPoint=code_block.out0, radius=code_block.out1)
Sphere = Output(byCenterPointRadius)
