# Dynamo graph custom-node-partial-application-test.dyn (Dynamo 0.9.1.2957)

number = DoubleInput(5)
byCenterPointRadius = Circle.ByCenterPointRadius(radius=number)
number_2 = DoubleInput(0.5)
pointAtParameter = Curve.PointAtParameter(curve=byCenterPointRadius, param=number_2)
byCenterPointRadius_2 = Sphere.ByCenterPointRadius(centerPoint=pointAtParameter)
number_3 = DoubleInput(0..5)
number_4 = DoubleInput(0.7)
code_block = CodeBlock { 5; }
five_cubes = Custom[Five Cubes](size=number_4, count=code_block)  # A node that creates 5 cubes.
map = List.Map(list=number_3, f_x=five_cubes.Cubes)
