# Dynamo graph custom-node-test.dyn (Dynamo 0.9.1.2957)

number = DoubleInput(0.7)
number_2 = DoubleInput(0)
code_block = CodeBlock { 5; }
five_cubes = Custom[Five Cubes](size=number, offset=number_2, count=code_block)  # A node that creates 5 cubes.
number_3 = DoubleInput(2)
five_cubes_2 = Custom[Five Cubes](size=number, offset=number_3, count=code_block)
number_4 = DoubleInput(5)
byCenterPointRadius = Circle.ByCenterPointRadius(radius=number_4)
number_5 = DoubleInput(0.5)
pointAtParameter = Curve.PointAtParameter(curve=byCenterPointRadius, param=number_5)
byCenterPointRadius_2 = Sphere.ByCenterPointRadius(centerPoint=pointAtParameter)
