# Dynamo graph 200910 dynamo isolate selected visibility.dyn (Dynamo 2.9.0.2746)

planes_represent_livable_space = BoolSelector(true)  # graph input
file_path = Filename(".\20200910 selection.sat")
importFromSAT = Geometry.ImportFromSAT(file=file_path)

# group: surface type
code_block = CodeBlock { return "Autodesk.DesignScript.Geometry.Surface"; }

# group: get only the surfaces
type = Object.Type(obj=importFromSAT)
contains = String.Contains(str=type, searchFor=code_block)
filterByBoolMask = List.FilterByBoolMask(list=importFromSAT, mask=contains)

# group: get perimeter curves of all surfaces
perimeterCurves = Surface.PerimeterCurves(surface=filterByBoolMask.in)
byJoinedCurves = PolyCurve.ByJoinedCurves(curves=perimeterCurves)

roof_overhang = DoubleSlider(6, range=0..100 step 0.1)  # graph input

# group: offset if the selected planes are supposed to represent the livable space
offset = Curve.Offset(curve=byJoinedCurves, distance=roof_overhang)

# group: // get the outer roof curves depending on whether livable spaces is checked
code_block_2 = CodeBlock(x=planes_represent_livable_space, listA=offset, listB=byJoinedCurves)
# ---------- code_block_2.designscript (11 lines) ----------
x;
listA;
listB;
[Imperative]
{
if(x==true){
	return = listA;
}else{
		return = listB;
	}
};
# ----------------------------------------

ZAxis = Vector.ZAxis()
reverse = Vector.Reverse(vector=ZAxis)
roof_thickness = DoubleSlider(0.5, range=0..10 step 0.1)  # graph input

# group: extrude roof planes
extrudeAsSolid = Curve.ExtrudeAsSolid(curve=code_block_2.out3, direction=reverse, distance=roof_thickness)

count = List.Count(list=code_block_2.out3)
code_block_3 = CodeBlock { 0.5; }
pointAtParameter = Surface.PointAtParameter(surface=filterByBoolMask.in, u=code_block_3, v=code_block_3)

# group: height of each plane
Z = Point.Z(point=pointAtParameter)

code_block_4 = CodeBlock(x=roof_overhang) { -x; }

# group: all selection points
startPoint = Curve.StartPoint(curve=perimeterCurves)

Z_2 = Point.Z(point=startPoint)

# group: minimum height of each plane
minimumItem = List.MinimumItem(list=Z_2)

indexOf = List.IndexOf(list=Z_2, element=minimumItem, lacing=Longest)

# group: minimum point on each plane
getItemAtIndex = List.GetItemAtIndex(list=startPoint, index=indexOf, lacing=Longest)

ZAxis_2 = Vector.ZAxis()
byOriginNormal = Plane.ByOriginNormal(origin=getItemAtIndex, normal=ZAxis_2)
pullOntoPlane = Curve.PullOntoPlane(curve=byJoinedCurves, plane=byOriginNormal, lacing=Longest)

# group: get the parameter of the minimum point on each plane
parameterAtPoint = Curve.ParameterAtPoint(curve=byJoinedCurves, point=getItemAtIndex, lacing=Longest)

# group: get a CS at each minimum point
coordinateSystemAtParameter = Curve.CoordinateSystemAtParameter(curve=byJoinedCurves, param=parameterAtPoint, lacing=Longest)
