# Dynamo graph CoordinateSystems.dyn (Dynamo 2.9.0.2637)

byCenterPointRadius = Sphere.ByCenterPointRadius()
explode = Geometry.Explode(geometry=byCenterPointRadius)
code_block = CodeBlock { 0..1..0.1; }
coordinateSystemAtParameter = Surface.CoordinateSystemAtParameter(surface=explode, u=code_block, v=code_block)
code_block_2 = CodeBlock(a=explode) { a[0]; }
