# Dynamo graph linecolors.dyn (Dynamo 2.6.0.8086)

code_block = CodeBlock { 0..10; }
code_block_2 = CodeBlock(x=code_block, y=code_block, z=code_block) { Point.ByCoordinates(x<1>,y<2>,z<3>); }
code_block_3 = CodeBlock { 15; }
translate = Geometry.Translate(geometry=code_block_2, xTranslation=code_block_3)
code_block_4 = CodeBlock(x=translate) { List.Flatten(x); }
color_palette = ColorPalette({R: 0, G: 0, B: 255, A: 255})
color_palette_2 = ColorPalette({R: 255, G: 20, B: 147, A: 255})
code_block_5 = CodeBlock(a=color_palette, b=color_palette_2) { [a,b]; }
code_block_6 = CodeBlock { [0,1]; }
code_block_7 = CodeBlock(x=code_block_2) { List.Count(List.Flatten(x)); }
code_block_8 = CodeBlock(count=code_block_7) { 0..1..#count; }
color_range = ColorRange(colors=code_block_5, indices=code_block_6, value=code_block_8)
byGeometryColor = Modifiers.GeometryColor.ByGeometryColor(geometry=code_block_4, color=color_range)
code_block_9 = CodeBlock { 10; }
translate_2 = Geometry.Translate(geometry=code_block_2, yTranslation=code_block_9, zTranslation=code_block_9)
regularLines = Line.ByStartPointEndPoint(startPoint=translate_2, endPoint=code_block_2)
translate_3 = Geometry.Translate(geometry=translate, yTranslation=code_block_9, zTranslation=code_block_9)
byStartPointEndPoint = Line.ByStartPointEndPoint(startPoint=translate, endPoint=translate_3)
code_block_10 = CodeBlock(x=byStartPointEndPoint) { List.Flatten(x); }
coloredLines = Modifiers.GeometryColor.ByGeometryColor(geometry=code_block_10, color=color_range)
