# Dynamo graph pointcolors.dyn (Dynamo 2.6.0.8086)

code_block = CodeBlock { 0..10; }
regularpoints = CodeBlock(x=code_block, y=code_block, z=code_block) { Point.ByCoordinates(x<1>,y<2>,z<3>); }
code_block_2 = CodeBlock { 15; }
translate = Geometry.Translate(geometry=regularpoints, xTranslation=code_block_2)
code_block_3 = CodeBlock(x=translate) { List.Flatten(x); }
color_palette = ColorPalette({R: 0, G: 0, B: 255, A: 255})
color_palette_2 = ColorPalette({R: 255, G: 20, B: 147, A: 255})
code_block_4 = CodeBlock(a=color_palette, b=color_palette_2) { [a,b]; }
code_block_5 = CodeBlock { [0,1]; }
code_block_6 = CodeBlock(x=regularpoints) { List.Count(List.Flatten(x)); }
code_block_7 = CodeBlock(count=code_block_6) { 0..1..#count; }
color_range = ColorRange(colors=code_block_4, indices=code_block_5, value=code_block_7)
colorpoints = Modifiers.GeometryColor.ByGeometryColor(geometry=code_block_3, color=color_range)
