# Dynamo graph smallring.dyn (Dynamo 2.11.0.3775)

bottom_diameter = DoubleSlider(2.25, range=0..100 step 0.1)  # graph input
code_block = CodeBlock { 2; }

# group: convert to radius
div = bottom_diameter / code_block

byCenterPointRadius = Circle.ByCenterPointRadius(radius=div)
receptacle_height = DoubleSlider(2.5, range=0..100 step 0.1)  # graph input

# group: move bottom curve up to top
translate = Geometry.Translate(geometry=byCenterPointRadius, zTranslation=receptacle_height)

top_band_height = DoubleSlider(0.06, range=0..10 step 0.1)  # graph input

# group: initial top band wall
extrude = Curve.Extrude(curve=translate, distance=top_band_height)

receptacle_wall_thickness = DoubleSlider(0.02, range=0..10 step 0.1)  # graph input
code_block_2 = CodeBlock(x=receptacle_wall_thickness) { -x; }
code_block_3 = CodeBlock { false; }

# group: thicken top band
selectNode = Surface.Thicken(surface=extrude, thickness=code_block_2, both_sides=code_block_3)

selectNode2 = Surface.Thicken(surface=extrude, thickness=code_block_2, both_sides=code_block_3)
selectNode3 = Surface.Thicken(surface=extrude, thickness=code_block_2, both_sides=code_block_3)
