# Dynamo graph spherecolors.dyn (Dynamo 2.6.0.8086)

spherenormal = Sphere.ByCenterPointRadius()
code_block = CodeBlock { 2; }
translate = Geometry.Translate(geometry=spherenormal, xTranslation=code_block)
color_palette = ColorPalette({R: 255, G: 20, B: 147, A: 255})
spherevertcolors = Modifiers.GeometryColor.ByGeometryColor(geometry=translate, color=color_palette)
explode = Geometry.Explode(geometry=translate)
translate_2 = Geometry.Translate(geometry=explode, xTranslation=code_block)
code_block_2 = CodeBlock { 2; }
ofRepeatedItem = List.OfRepeatedItem(item=color_palette, amount=code_block_2)
sphereflatcolors = Modifiers.GeometryColor.BySurfaceColors(surface=translate_2, colors=ofRepeatedItem)
