# Dynamo graph tsplineTest_fast.dyn (Dynamo 2.14.0.3430)

code_block = CodeBlock { 10; }
byLengths = Cuboid.ByLengths(width=code_block, length=code_block, height=code_block)
code_block_2 = CodeBlock { 3; }
byCenterPointRadius = Sphere.ByCenterPointRadius(radius=code_block_2)
difference = Solid.Difference(solid=byLengths, other=byCenterPointRadius)
code_block_3 = CodeBlock { -7..7..#3; }
translate = Geometry.Translate(geometry=difference, xTranslation=code_block_3, yTranslation=code_block_3, zTranslation=code_block_3, lacing=CrossProduct)
join = List.Join(list0=difference)  # unwired: list1
code_block_4 = CodeBlock { 10; }
code_block_5 = CodeBlock { 3; }
byCenterPointRadius_2 = Sphere.ByCenterPointRadius(radius=code_block_5)
difference_2 = Solid.Difference(solid=byLengths, other=byCenterPointRadius_2)
code_block_6 = CodeBlock { 2; }
scale = Geometry.Scale(geometry=difference_2, xamount=code_block_6, yamount=code_block_6, zamount=code_block_6)
edges = Topology.Edges(topology=scale)
curveGeometry = Edge.CurveGeometry(edge=edges)
code_block_7 = CodeBlock { 0.5; 1; true; }
buildPipes = TSpline.TSplineSurface.BuildPipes(curves=curveGeometry, defaultRadius=code_block_7.out0, segmentsCount=code_block_7.out1, inSmoothMode=code_block_7.out2)
edges_2 = Topology.Edges(topology=buildPipes)
curves_select = Edge.CurveGeometry(edge=edges_2)
toBRep = TSpline.TSplineSurface.ToBRep(tSplineSurface=buildPipes)
faces = Topology.Faces(topology=toBRep)
surfaceGeometry = Face.SurfaceGeometry(face=faces)
code_block_8 = CodeBlock { 0..1..#10; }
points_select = Surface.PointAtParameter(surface=surfaceGeometry, u=code_block_8, v=code_block_8, lacing=CrossProduct)
tspline_select = Object.Identity(object=buildPipes)
