# Dynamo graph wavysurface.dyn (Dynamo 2.7.0.8376)

file_path = Filename(".\wavysurface.sat")
importFromSAT = Geometry.ImportFromSAT(filePath=file_path)
code_block = CodeBlock { 100; }
scale = Geometry.Scale(geometry=importFromSAT, amount=code_block)
number_slider = DoubleSlider(0.61, range=0..1 step 0.01)
number_slider_2 = DoubleSlider(0.33, range=0..1 step 0.01)
pointAtParameter = Surface.PointAtParameter(surface=scale, u=number_slider, v=number_slider_2)
normalAtParameter = Surface.NormalAtParameter(surface=scale, u=number_slider, v=number_slider_2)
byStartPointDirectionLength = Line.ByStartPointDirectionLength(startPoint=pointAtParameter, direction=normalAtParameter)
number_slider_3 = DoubleSlider(0, range=0..1000 step 1)
number_slider_4 = DoubleSlider(6, range=0..1000 step 1)
byCoordinates = Point.ByCoordinates(x=number_slider_3, y=number_slider_4)
XAxis = Vector.XAxis()
code_block_2 = CodeBlock { 180; }
rotate = Geometry.Rotate(geometry=scale, origin=byCoordinates, axis=XAxis, degrees=code_block_2)
code_block_3 = CodeBlock { 14; }
translate = Geometry.Translate(geometry=rotate, xTranslation=code_block_3)
