# Dynamo graph instancing_cubes_cones_edges.dyn (Dynamo 2.15.0.5027)

code_block = CodeBlock { 0..20..5; }
byCoordinates = Point.ByCoordinates(x=code_block, y=code_block, z=code_block, lacing=CrossProduct)
byLengths = Cuboid.ByLengths(origin=byCoordinates)
byPointsRadius = Cone.ByPointsRadius(startPoint=byCoordinates)
