# Dynamo graph instancing_cubes_edges.dyn (Dynamo 2.15.0.5081)

code_block = CodeBlock { 2..20..5; }
byCoordinates = Point.ByCoordinates(x=code_block, y=code_block, z=code_block, lacing=CrossProduct)
byPointsRadius = Cone.ByPointsRadius(startPoint=byCoordinates)
code_block_2 = CodeBlock { 2; }
byLengths = Cuboid.ByLengths(origin=byCoordinates, width=code_block_2)
centroid = Solid.Centroid(solid=byLengths)
flatten = List.Flatten(list=centroid)
firstItem = List.FirstItem(list=flatten)
