# Dynamo graph instancing_lines.dyn (Dynamo 2.15.0.4978)

code_block = CodeBlock()
# ---------- code_block.designscript (6 lines) ----------
def csToArray(cs:CoordinateSystem){

return [cs.Origin.X,cs.Origin.Y,cs.Origin.Z,
cs.XAxis.X,cs.XAxis.Y,cs.XAxis.Z,cs.YAxis.X,cs.YAxis.Y,cs.YAxis.Z,
cs.ZAxis.X,cs.ZAxis.Y,cs.ZAxis.Z];
};
# ----------------------------------------
XY = Plane.XY()
code_block_2 = CodeBlock { 5; }
code_block_3 = CodeBlock(len=code_block_2) { 0..len; }
translate = Geometry.Translate(geometry=XY, xTranslation=code_block_3, yTranslation=code_block_3, zTranslation=code_block_3, lacing=CrossProduct)
toCoordinateSystem = Plane.ToCoordinateSystem(plane=translate)
flatten = List.Flatten(list=toCoordinateSystem)
code_block_4 = CodeBlock(cs=flatten) { csToArray(cs); }
count = List.Count(list=flatten)
code_block_5 = CodeBlock(x=count) { 0..1..#x*3; }
code_block_6 = CodeBlock { 3; }
chop = List.Chop(list=code_block_5, lengths=code_block_6)
byPositionAndAxes = FFITarget.InstanceableLineClass.ByPositionAndAxes(position_x_y_z_axes=code_block_4, width_length_height=chop)
