# Dynamo graph instancing_no_instance_data.dyn (Dynamo 2.13.0.3136)

code_block = CodeBlock { 0..100..0.1; }
code_block_2 = CodeBlock(x=code_block) { x*10; }
sin = Math.Sin(angle=code_block_2)
code_block_3 = CodeBlock(x=sin) { x*5; }
code_block_4 = CodeBlock(x=code_block, y=code_block_3, z=code_block_3) { [x,y,z]; }
transpose = List.Transpose(lists=code_block_4)
code_block_5 = CodeBlock { 3; }
chop = List.Chop(list=transpose, lengths=code_block_5)
byPositionAndAxes = FFITarget.InstanceableClass_NoInstanceData.ByPositionAndAxes(position=chop)
list_create = List.Create()  # unwired: item0
