# Dynamo graph instancing_transformables.dyn (Dynamo 2.15.0.4978)

XY = Plane.XY()
code_block = CodeBlock { 5; }
code_block_2 = CodeBlock(len=code_block) { 0..len; }
translate = Geometry.Translate(geometry=XY, xTranslation=code_block_2, yTranslation=code_block_2, zTranslation=code_block_2, lacing=CrossProduct)
toCoordinateSystem = Plane.ToCoordinateSystem(plane=translate)
flatten = List.Flatten(list=toCoordinateSystem)
code_block_3 = CodeBlock(cs=flatten) { csToArray(cs); }
count = List.Count(list=flatten)
code_block_4 = CodeBlock(x=count) { 0..1..#x*3; }
code_block_5 = CodeBlock { 3; }
chop = List.Chop(list=code_block_4, lengths=code_block_5)
byPositionAndAxes = FFITarget.InstanceableClass.ByPositionAndAxes(position_x_y_z_axes=code_block_3, width_length_height=chop)
code_block_6 = CodeBlock()
# ---------- code_block_6.designscript (6 lines) ----------
def csToArray(cs:CoordinateSystem){

return [cs.Origin.X,cs.Origin.Y,cs.Origin.Z,
cs.XAxis.X,cs.XAxis.Y,cs.XAxis.Z,cs.YAxis.X,cs.YAxis.Y,cs.YAxis.Z,
cs.ZAxis.X,cs.ZAxis.Y,cs.ZAxis.Z];
};
# ----------------------------------------
identity = CoordinateSystem.Identity()
byCoordinates = Point.ByCoordinates()
ZAxis = Vector.ZAxis()
code_block_7 = CodeBlock { 15; }
rotate = CoordinateSystem.Rotate(coordinateSystem=identity, origin=byCoordinates, axis=ZAxis, degrees=code_block_7)
code_block_8 = CodeBlock { 0.5; }
scale = CoordinateSystem.Scale(coordinateSystem=rotate, xamount=code_block_8, yamount=code_block_8)
byPositionAndAxes_2 = FFITarget.InstanceAndTransformable.ByPositionAndAxes(position_x_y_z_axes=code_block_3, width_length_height=chop, transform=scale)
