# Dynamo graph magn_10809.dyn (Dynamo 1.2.1.3062)

code_block = CodeBlock { 2..1; }
byCoordinates = Point.ByCoordinates(x=code_block, y=code_block, z=code_block, lacing=CrossProduct)
number_slider = DoubleSlider(0.45, range=0..1 step 0.05)
byCenterPointRadius = Sphere.ByCenterPointRadius(centerPoint=byCoordinates, radius=number_slider)
