# Dynamo graph CombinedBuildAndRuntimeWarning.dyn (Dynamo 3.0.0.5795)

byLengths = Cuboid.ByLengths()
vertices = Topology.Vertices(topology=byLengths)
firstItem = List.FirstItem(list=vertices)
remember = Remember(firstItem)
