# Dynamo graph DeleteInlineWatch_RewireFixture.dyn (Dynamo 4.1.0.2940)

code_block = CodeBlock { 42; }
watch = Watch(code_block)
code_block_2 = CodeBlock(answer=watch) { answer; }
code_block_3 = CodeBlock(answer=watch) { answer*2; }
