# Dynamo graph Watch1DCollections.dyn (Dynamo 0.6.3.26460)

number = DoubleInput(1..10)
watchNumbers = Watch(number)
byCoordinates = Vector.ByCoordinates(watchNumbers, watchNumbers, watchNumbers)
watchVectors = Watch(byCoordinates)
number_2 = DoubleInput(0..15..3)
code_block = CodeBlock(x=number_2) { x % 2 > 0 ? false : true; }
watchBooleans = Watch(code_block)
