# Dynamo graph WatchDictionaryUintValuesDisplaysCorrectly.dyn (Dynamo 3.5.0.6885)

previewUint64Dictionary = FFITarget.DummyZeroTouchClass.PreviewUint64Dictionary()
previewUint32Dictionary = FFITarget.DummyZeroTouchClass.PreviewUint32Dictionary()
watch = Watch(previewUint32Dictionary)
