# Dynamo graph WatchLiterals.dyn (Dynamo 1.0.1.1743)

number = DoubleInput(5)
numberWatch = Watch(number)
code_block = CodeBlock(x=numberWatch) { x % 2 > 0 ? false : true; }
booleanWatch = Watch(code_block)
byCoordinates = Point.ByCoordinates(x=number, y=number, z=number)
pointWatch = Watch(byCoordinates)
