# Dynamo graph WatchNumber.dyn (Dynamo 2.0.0.4397)

number = DoubleInput(3.14)  # graph input
watch = Watch(number)
code_block = CodeBlock { 3.14; }
watch_2 = Watch(code_block)
number_slider = DoubleSlider(3.14, range=0..100 step 0.1)  # graph input
watch_3 = Watch(number_slider)
