# Dynamo graph WatchSerializationTest.dyn

codeBlock = CodeBlock()
# ---------- codeBlock.designscript (5 lines) ----------
1..10;
"asdsadasdasdadassadsadasdsadsadasad";
11..20;
dict = {"a":1, "b":2, "c":3};
d = {"a":1, "b":2, "c":3,"d": 4, "e": dict};
# ----------------------------------------
watch = Watch(codeBlock.out0)
