# Dynamo graph WatchViewModelGetNodeLabelTree.dyn (Dynamo 2.7.0.9206)

code_block = CodeBlock()
# ---------- code_block.designscript (45 lines) ----------
[
  true,
  "Hello, world!",
  false,
  Point.ByCoordinates(1, 1, 1),
  [
    Cuboid.ByLengths(1, 1, 1),
    0
  ],
  -3.147,
  [
    [
      [
        true
      ],
      false,
      true,
      null
    ]
  ],
  [],
  {},
  {
    "Type": "2B4P",
    "Area": 70,
    "Rooms": [
      {
        "Type": "Bedroom",
        "Area": 12
      },
      {
        "Type": "Bedroom",
        "Area": 12
      },
      {
        "Type": "Bathroom",
        "Area": 5
      },
      {
        "Type": "Living/Kitchen/Dining",
        "Area": 27
      }
    ]
  }
];
# ----------------------------------------
watch = Watch(code_block)
code_block_2 = CodeBlock { "Hello, world!"; }
watch_2 = Watch(code_block_2)
