# Dynamo graph infobubble_warning_on_n2c.dyn (Dynamo 2.14.0.4472)

code_block = CodeBlock { 10; }
code_block_2 = CodeBlock { 180; }
byCenterPointRadiusAngle = Arc.ByCenterPointRadiusAngle(radius=code_block, endAngle=code_block_2)
endPoint = Curve.EndPoint(curve=byCenterPointRadiusAngle)
code_block_3 = CodeBlock { 10; }
byCoordinates = Point.ByCoordinates(z=code_block_3)
byStartPointEndPoint = Line.ByStartPointEndPoint(startPoint=endPoint, endPoint=byCoordinates)
code_block_4 = CodeBlock(a=byStartPointEndPoint, b=byCenterPointRadiusAngle) { [a,b]; }
byJoinedCurves = PolyCurve.ByJoinedCurves(curves=code_block_4)
pointsAtEqualChordLength = Curve.PointsAtEqualChordLength(curve=byJoinedCurves)
