# Dynamo graph selectbycat.dyn (Dynamo 2.13.1.3887)

select_model_element_by_category = DSModelElementByCategorySelection("OST_Levels")  # nothing selected
current = Document.Current()
spec_types = SpecTypes("autodesk.spec.aec:length")
unitTypeBySpecType = Document.UnitTypeBySpecType(document=current, specType=spec_types)
