# Dynamo graph watchFunctionPointer.dyn (Dynamo 0.8.2.2095)

code_block = CodeBlock { Autodesk.DesignScript.Geometry.Point.Origin; }
watch = Watch(code_block)
code_block_2 = CodeBlock()
# ---------- code_block_2.designscript (5 lines) ----------
def foo()
{
}

x = foo;
# ----------------------------------------
watch_2 = Watch(code_block_2)
