# Dynamo graph ListMinimum_NumberRange.dyn

number = DoubleInput(5)
greater_than = GreaterThan(arg1=number)
number_2 = DoubleInput(-1)
number_slider = DoubleSliderInput(9.249743063, range=0..10)
number_3 = DoubleInput(1)
number_range = NumberRange(number_2, number_slider, number_3, lacing=Longest)
list_minimum = ListMin(greater_than, number_range)
watch = Watch(list_minimum)
