# Dynamo graph Map_SimpleTest.dyn

number = DoubleInput(4)
add = Addition(arg1=number)
number_2 = DoubleInput(2)
list = NewList(index0=number_2, index1=number_2, index2=number_2)
map = Map(add, list)
watch = Watch(map)
