# Dynamo graph Reduce_SimpleTest.dyn

multiply = Multiplication(lacing=Longest)
number = DoubleInput(-2)
number_2 = DoubleInput(2)
number_3 = DoubleInput(5)
number_4 = DoubleInput(5.6)
list = NewList(index0=number_2, index1=number_3, index2=number_4)
reduce = Fold(multiply, number, list)
watch = Watch(reduce)
