# Dynamo graph SortBy_SimpleTest.dyn

number = DoubleInput(8)
less_than = LessThan(arg1=number)
number_2 = DoubleInput(10.23)
number_3 = DoubleInput(5.6)
number_4 = DoubleInput(98)
number_5 = DoubleInput(0.45)
list = NewList(index0=number_2, index1=number_3, index2=number_4, index3=number_5, index4=number)
sort_by = SortBy(less_than, list)
watch = Watch(sort_by)
watch_2 = Watch(list)
