# Dynamo graph sequence.dyn

filename = StringFilename("C:\Users\kronz\Documents\2013-05-09_1555.png")
number = DoubleInput(0)
read_image_file = ImageFileReader(filename, number, number)
number_2 = DoubleInput(1)
number_slider = DoubleSliderInput(50, range=0..100)
number_sequence = BuildSeq(number_2, number_slider, number_2)
formula = Formula("Sin(x)", x=number_sequence, lacing=Longest)
watch = Watch(formula)
