# Dynamo graph sorting.dyn

string = StringInput("dddd")
string_2 = StringInput("aa")
string_3 = StringInput("c")
string_4 = StringInput("aaaaa")
string_5 = StringInput("bbb")
list = NewList(index0=string, index1=string_2, index2=string_3, index3=string_4, index4=string_5)
sort = Sort(list)
watch = Watch(sort)
string_length = StringLen()
sort_by = SortBy(string_length, list)
watch_2 = Watch(sort_by)
