# Dynamo custom node Sequence2.dyf
# category: Core.Lists
# A sequence generator

start = Input()
end = Input()
formula = Formula("x-1", x=end)
step = Input()
number_sequence = NumberRange(start, formula, step)
Output = Output(number_sequence)  # ""
