# Dynamo graph combine-with-three.dyn

number = DoubleInput(0)
number_2 = DoubleInput(3)
number_3 = DoubleInput(1)
sequence2 = Custom[Sequence2](start=number, end=number_2, step=number_3)
number_4 = DoubleInput(6)
sequence2_2 = Custom[Sequence2](start=number_2, end=number_4, step=number_3)
number_5 = DoubleInput(9)
sequence2_3 = Custom[Sequence2](start=number_4, end=number_5, step=number_3)
combine2 = Custom[combine2](list1=sequence2, list2=sequence2_2, list3=sequence2_3)
watch = Watch(combine2)
