# Dynamo graph tests.dyn

file_path = StringFilename("C:\Users\boyerp\Dropbox\Github\Autodesk\Dynamo\test\good_dyns\excel\tests.xlsx")
open_excel_workbook = ReadExcelFile(file_path)
number = DoubleInput(0)
get_excel_worksheet_by_index = GetExcelWorksheetByIndex(open_excel_workbook, number)
get_data_from_excel_worksheet = GetDataFromExcelWorksheet(get_excel_worksheet_by_index)
number_2 = DoubleInput(4)
number_3 = DoubleInput(4)
string = StringInput("Pedro")
write_data_to_excel_worksheet = WriteDataToExcelWorksheet(get_excel_worksheet_by_index, number_2, number_3, string)
add_excel_worksheet_to_workbook = AddExcelWorksheetToWorkbook(open_excel_workbook, string)
save_excel_workbook_as = SaveAsExcelWorkbook(open_excel_workbook, file_path)
perform_all = Begin(expr1=write_data_to_excel_worksheet, expr2=add_excel_worksheet_to_workbook, expr3=save_excel_workbook_as)
