# Dynamo graph filter-example.dyn

is_odd = Custom[is-odd]()
number = DoubleInput(1)
number_2 = DoubleInput(5)
number_sequence = BuildSeq(number, number_2, number)
filter = Filter(is_odd, number_sequence)
watch = Watch(filter)
filter_out = FilterOut(is_odd, number_sequence)
watch_2 = Watch(filter_out)
not_ = Not()
compose_functions = ComposeFunctions(is_odd, not_)
filter_2 = Filter(compose_functions, number_sequence)
watch_3 = Watch(filter_2)
