# Dynamo graph TestConcatString_fromFile.dyn

file_path = StringFilename("C:\Users\t_nguys\Documents\GitHub\Dynamo\test\good_dyns\string\TestConcatString_fromFile.txt")
read_text_file = FileReader(file_path)
concat_strings = ConcatStrings(read_text_file, read_text_file)
watch = Watch(concat_strings)
