# Dynamo graph TestJoinString_fromFile.dyn

file_path = StringFilename("C:\Users\t_nguys\Documents\GitHub\Dynamo\test\good_dyns\string\TestJoinString_fromFile.txt")
read_text_file = FileReader(file_path)
string = StringInput("x")
list = NewList(index0=read_text_file, index1=string)
string_2 = StringInput(".")
join_strings = JoinStrings(list, string_2)
watch = Watch(join_strings)
