# Dynamo graph TestJoinString_normal.dyn

string = StringInput("first")
string_2 = StringInput("second")
list = NewList(index0=string, index1=string_2)
string_3 = StringInput(".")
join_strings = JoinStrings(list, string_3)
watch = Watch(join_strings)
