# Dynamo graph TestSplitString_fromFile.dyn

file_path = StringFilename("C:\Users\t_nguys\Documents\GitHub\Dynamo\test\good_dyns\string\TestSplitString_fromFile.txt")
read_text_file = FileReader(file_path)
string = StringInput(".")
split_string = SplitString(read_text_file, string)
watch = Watch(split_string)
