# Dynamo graph TestStringCase_fromFile.dyn

file_path = StringFilename("C:\Users\t_nguys\Documents\GitHub\Dynamo\test\good_dyns\string\TestStringCase_fromFile.txt")
read_text_file = FileReader(file_path)
boolean = BoolSelector(true)
string_case = StringCase(read_text_file, boolean)
watch = Watch(string_case)
