# Dynamo graph TestStringLength_fromFile.dyn

file_path = StringFilename("C:\Users\t_nguys\Documents\GitHub\Dynamo\test\good_dyns\string\TestStringLength_fromFile.txt")
read_text_file = FileReader(file_path)
string_length = StringLen(read_text_file)
watch = Watch(string_length)
