# Dynamo graph TestStringLength_fromFunction.dyn

string = StringInput("a")
string_2 = StringInput("bc")
concat_strings = ConcatStrings(string, string_2)
string_length = StringLen(concat_strings)
watch = Watch(string_length)
