# Dynamo graph TestSubstring_fromFile.dyn

file_path = StringFilename("C:\Users\t_nguys\Documents\GitHub\Dynamo\test\good_dyns\string\TestSubstring_fromFile.txt")
read_text_file = FileReader(file_path)
number = DoubleInput(4)
number_2 = DoubleInput(7)
substring = Substring(read_text_file, number, number_2)
watch = Watch(substring)
