# Dynamo graph TestSubstring_fromFunction.dyn

string = StringInput("the ")
string_2 = StringInput("rainbow")
concat_strings = ConcatStrings(string, string_2)
number = DoubleInput(4)
number_2 = DoubleInput(7)
substring = Substring(concat_strings, number, number_2)
watch = Watch(substring)
