# Dynamo graph TestToString_fromFile.dyn

file_path = StringFilename("C:\Users\t_nguys\Documents\GitHub\Dynamo\test\good_dyns\string\TestToString_fromFile.txt")
read_text_file = FileReader(file_path)
to_string = ToString(read_text_file)
watch = Watch(to_string)
