# Dynamo graph TestToString_fromFunction.dyn

string = StringInput("123")
string_2 = StringInput("2")
split_string = SplitString(string, string_2)
to_string = ToString(split_string)
watch = Watch(to_string)
