# Dynamo custom node Filter by I and C section shapes.dyf "Filter by Section Shape" (Dynamo 2.1.0.7500)
# category: Autodesk Steel Connections.Filter
# Filters by all I and C section shapes

node = Input(node: var)
code_block = CodeBlock { 0; }
structuralSectionShapes = StructuralSectionShapes("I-shape Parallel Flange")
bySectionShape = AdvanceSteel.ConnectionAutomation.Nodes.Filter.BySectionShape(node=node, index=code_block, shapeToFind=structuralSectionShapes)
structuralSectionShapes_2 = StructuralSectionShapes("I-shape Sloped Flange")
bySectionShape_2 = AdvanceSteel.ConnectionAutomation.Nodes.Filter.BySectionShape(node=bySectionShape.rejected, index=code_block, shapeToFind=structuralSectionShapes_2)
structuralSectionShapes_3 = StructuralSectionShapes("I-split Parallel Flange")
bySectionShape_3 = AdvanceSteel.ConnectionAutomation.Nodes.Filter.BySectionShape(node=bySectionShape_2.rejected, index=code_block, shapeToFind=structuralSectionShapes_3)
structuralSectionShapes_4 = StructuralSectionShapes("I-split Sloped Flange")
bySectionShape_4 = AdvanceSteel.ConnectionAutomation.Nodes.Filter.BySectionShape(node=bySectionShape_3.rejected, index=code_block, shapeToFind=structuralSectionShapes_4)
structuralSectionShapes_5 = StructuralSectionShapes("I-shape Welded")
bySectionShape_5 = AdvanceSteel.ConnectionAutomation.Nodes.Filter.BySectionShape(node=bySectionShape_4.rejected, index=code_block, shapeToFind=structuralSectionShapes_5)
structuralSectionShapes_6 = StructuralSectionShapes("I-shape Wide Flange")
bySectionShape_6 = AdvanceSteel.ConnectionAutomation.Nodes.Filter.BySectionShape(node=bySectionShape_5.rejected, index=code_block, shapeToFind=structuralSectionShapes_6)
structuralSectionShapes_7 = StructuralSectionShapes("C-channel Parallel Flange")
bySectionShape_7 = AdvanceSteel.ConnectionAutomation.Nodes.Filter.BySectionShape(node=bySectionShape_6.rejected, index=code_block, shapeToFind=structuralSectionShapes_7)
structuralSectionShapes_8 = StructuralSectionShapes("C Profile")
bySectionShape_8 = AdvanceSteel.ConnectionAutomation.Nodes.Filter.BySectionShape(node=code_block, index=code_block, shapeToFind=structuralSectionShapes_8)
structuralSectionShapes_9 = StructuralSectionShapes("C Profile with Fold ")
bySectionShape_9 = AdvanceSteel.ConnectionAutomation.Nodes.Filter.BySectionShape(node=bySectionShape_8.rejected, index=code_block, shapeToFind=structuralSectionShapes_9)
structuralSectionShapes_10 = StructuralSectionShapes("C Profile with Lips")
bySectionShape_10 = AdvanceSteel.ConnectionAutomation.Nodes.Filter.BySectionShape(node=code_block, index=code_block, shapeToFind=structuralSectionShapes_10)
structuralSectionShapes_11 = StructuralSectionShapes("C-channel Sloped Flange")
bySectionShape_11 = AdvanceSteel.ConnectionAutomation.Nodes.Filter.BySectionShape(node=bySectionShape_10.rejected, index=code_block, shapeToFind=structuralSectionShapes_11)
list_create = List.Create(item0=bySectionShape.accepted, item1=bySectionShape_2.accepted, item2=bySectionShape_3.accepted, item3=bySectionShape_4.accepted, item4=bySectionShape_5.accepted, item5=bySectionShape_6.accepted, item6=bySectionShape_7.accepted, item7=bySectionShape_8.accepted, item8=bySectionShape_9.accepted, item9=bySectionShape_10.accepted, item10=bySectionShape_11.accepted)
list = Output(list_create)
