# Dynamo graph GraphNodeManagerTestGraph_NullsEmptyLists.dyn (Dynamo 2.16.0.1640)

singles = CodeBlock { singleNull = null; singleEmpty = []; singleString = "Hello"; singleNumber = 2.0; }
single_null = Watch(singles.singleNull)
single_empty_list = Watch(singles.singleEmpty)
single_string = Watch(singles.singleString)
single_number = Watch(singles.singleNumber)
lists = CodeBlock()
# ---------- lists.designscript (17 lines) ----------
listWithNull = [1,2,"hi",null];
listWithEmpty = [[],2,3,[],"bye"];
listWithBoth = [1,2,null,4,"five",[],null];
mestedListsWithBoth = [
	[
		null,1,2
	],
	[
		"string",2,3
	],
	[
		12,"hi","bye",
			[
				1,2,null,[]
			]
	]
];
# ----------------------------------------
list_with_nulls = Watch(lists.listWithNull)
list_with_empty_lists = Watch(lists.listWithEmpty)
list_with_nulls_and_empty_list = Watch(lists.listWithBoth)
nested_lists_with_nulls_and = Watch(lists.mestedListsWithBoth)  # "Nested Lists with Nulls and Empty Lists"
