# Dynamo custom node GetLowest.dyf "Get Lowest"
# category: CAAD_RWTH.Lists
# Gets the lowest value from a list

list = Input()
sort = Sort(list)
first_of_list = First(sort)
lowest = Output(first_of_list)
