# Dynamo custom node MyOR.dyf (Dynamo 2.9.0.2384)
# category: MyNodes
# Returns true if any of the arguments is true. Otherwise, it returns false.

a = Input(a: var[]..[])
b = Input(b: var[]..[])
code_block = CodeBlock(a=a, b=b) { c=a||b; }
Output = Output(code_block)  # ""
