# Dynamo custom node IfXGreaterThanY.dyf "If X > Y"
# category: CAAD_RWTH.Conditional
# Checks if X > Y and passes a specified value on true/false

x = Input()
y = Input()
formula = Formula("x>y", x=x, y=y, lacing=Longest)
true = Input()
# note: Why is this a custom node?
# So it can be used in conjunction with a Map node.
false = Input()
if_ = Conditional(formula, true, false)
result = Output(if_)
