# Dynamo custom node circles.dyf (Dynamo 2.7.0.8205)
# category: Test

byCoordinates = Point.ByCoordinates()
radius = Input(radius: double)
byCenterPointRadius = Circle.ByCenterPointRadius(centerPoint=byCoordinates, radius=radius)
x = Input(x: var[]..[])
code_block = CodeBlock(x=x) { 0..1..#x; }
pointAtParameter = Curve.PointAtParameter(curve=byCenterPointRadius, param=code_block)
code_block_2 = CodeBlock { 2; }
byCenterPointRadius_2 = Circle.ByCenterPointRadius(centerPoint=pointAtParameter, radius=code_block_2)
Circle = Output(byCenterPointRadius_2)
Circle_2 = Output(byCenterPointRadius)  # "Circle"
