# Dynamo custom node ANodeToModify.dyf
# category: Test
# Tells if a number in a range is even or odd

start = Input(start: var[]..[])
end = Input(end: var[]..[])
step = Input(step: var[]..[])
range = Range(start=start, end=end, step=step)
codeBlock = CodeBlock { 2; }
mod = range % codeBlock
codeBlock_2 = CodeBlock(x=mod) { x == 0 ? "even" : "odd"; }
Output = Output(codeBlock_2)  # ""
anewoutput = Output()  # unwired: arg0
