# Dynamo custom node CustomCeiling.dyf "Round Up To Precision"
# category: CAAD_RWTH.Math
# Rounds a number *up* to a specified precision

Number = Input()
Precision = Input()
formula = Formula("ceiling(a/b)*b", a=Number, b=Precision, lacing=Longest)
Ceiling = Output(formula)
