# Dynamo custom node CustomFloor.dyf "Round Down To Precision" (Dynamo 1.0.1.1743)
# category: CAAD_RWTH.Math
# Rounds a number *down* to a specified precision

Number = Input()
Precision = Input()
formula = Formula("floor(a/b)*b", a=Number, b=Precision, lacing=Longest)
Floor = Output(formula)
