# Dynamo graph AdaptiveComponent.dyn (Dynamo 0.7.0.26273)

list = NewList()
select_curve = CurvesBySelection()  # 1 picked in the model
number_slider = DoubleSliderInput(5, range=0..5)
xyz_array_on_curve = XyzArrayAlongCurve(select_curve, number_slider, lacing=Longest)
select_curve_2 = CurvesBySelection()  # 1 picked in the model
xyz_array_on_curve_2 = XyzArrayAlongCurve(select_curve_2, number_slider, lacing=Longest)
select_curve_3 = CurvesBySelection()  # 1 picked in the model
xyz_array_on_curve_3 = XyzArrayAlongCurve(select_curve_3, number_slider, lacing=Longest)
combine = Combine(list, xyz_array_on_curve, xyz_array_on_curve_2, xyz_array_on_curve_3)
select_fam = FamilyTypeSelector(index=2)
adaptive_component_by_points = AdaptiveComponentByPoints(combine, select_fam, lacing=Longest)
watch = Watch(combine)
