# Dynamo graph AdaptiveComponentByCurve.dyn (Dynamo 0.7.0.26273)

list = NewList()
number = DoubleInput(0)
number_2 = DoubleInput(30)
number_3 = DoubleInput(2)
number_range = NumberRange(number, number_2, number_3, lacing=Longest)
map = Map(list, number_range)
select_curve = CurvesBySelection()  # 1 picked in the model
curve_from_curve_element = CurveFromModelCurve(select_curve, lacing=Longest)
select_family_type = FamilyTypeSelector(index=0)
adaptive_component_by_parameter = AdaptiveComponentByParametersOnCurve(map, curve_from_curve_element, select_family_type, lacing=Longest)  # "Adaptive Component by Parameter on Curve"
watch = Watch()
