# Dynamo graph AdaptiveComponentByFace.dyn (Dynamo 0.7.0.26273)

list = NewList()
select_face = FormElementBySelection()  # 1 picked in the model
surface_domain = SurfaceDomain(select_face)
number = DoubleInput(10)
uv_grid = UvGrid(surface_domain, number, number)
map = Map(list, uv_grid)
select_family_type = FamilyTypeSelector(index=0)
adaptive_component_by_uvs_on = AdaptiveComponentByUvsOnFace(map, select_face, select_family_type, lacing=CrossProduct)
watch = Watch(surface_domain)
