# Dynamo graph BoxByTwoCorners.dyn (Dynamo 0.6.2.17383)

number = DoubleInput(2)
number_2 = DoubleInput(-1)
multiply = Multiplication(number, number_2, lacing=Longest)
XYZ = Xyz(multiply, multiply, multiply, lacing=Longest)
XYZ_2 = Xyz(number, number, number, lacing=Longest)
box_by_two_corners = SolidBoxByTwoCorners(XYZ, XYZ_2, lacing=Longest)
