# Dynamo graph MAGN-438_structuralFraming_simple.dyn (Dynamo 0.6.1.18684)

select_structural_framing_type = StructuralFramingSelector(index=0)
number = DoubleInput(0..50..10)
XYZ = Xyz(number, lacing=Longest)
number_2 = DoubleInput(10..20..#6)
XYZ_2 = Xyz(arg1=number_2, lacing=Longest)
add_xyzs = XyzAdd(XYZ, XYZ_2, lacing=Longest)
line_by_endpoints = LineBound(add_xyzs, XYZ, lacing=Longest)
z_axis = XyzBasisZ(lacing=Longest)
structural_framing = StructuralFraming(select_structural_framing_type, line_by_endpoints, z_axis)
watch = Watch(structural_framing)
string = StringInput("Cut Length")
get_family_instance_parameter = FamilyInstanceParameterGetter(structural_framing, string, lacing=Longest)  # "Get Family Instance Parameter Value"
