# Dynamo graph CurveCurveIntersection.dyn

select_curve = CurvesBySelection()  # 1 picked in the model
geometry_curve_from_model_curve = CurveFromModelCurve(select_curve, lacing=Longest)
select_curve_2 = CurvesBySelection()  # 1 picked in the model
geometry_curve_from_model_curve_2 = CurveFromModelCurve(select_curve_2, lacing=Longest)
curve_curve_intersection = CurveCurveIntersection(geometry_curve_from_model_curve, geometry_curve_from_model_curve_2, lacing=Longest)
watch = Watch(curve_curve_intersection.out0)
select_curve_3 = CurvesBySelection()  # 1 picked in the model
geometry_curve_from_model_curve_3 = CurveFromModelCurve(select_curve_3, lacing=Longest)
curve_curve_intersection_2 = CurveCurveIntersection(geometry_curve_from_model_curve, geometry_curve_from_model_curve_3, lacing=Longest)
list = NewList(index0=curve_curve_intersection_2.out0, index1=curve_curve_intersection_2.out1, index2=curve_curve_intersection_2.out2, index3=curve_curve_intersection_2.out3)
watch_2 = Watch(list)
list_2 = NewList(index0=curve_curve_intersection.out0, index1=curve_curve_intersection.out1, index2=curve_curve_intersection.out2, index3=curve_curve_intersection.out3)
watch_3 = Watch(list_2)
