# Dynamo graph CurvebyPointsEllipse.dyn

xyz_zero = XYZZero(lacing=Longest)
number = DoubleInput(30)
number_2 = DoubleInput(50)
number_3 = DoubleInput(0)
number_4 = DoubleInput(2)
ellipse_arc = EllipticalArc(xyz_zero, number, number_2, number_3, number_4, lacing=Longest)
curve_by_points_by_line = CurveByPointsByLine(ellipse_arc, lacing=Longest)
