# Dynamo graph GetCurveDomain.dyn

select_curve = CurvesBySelection()  # 1 picked in the model
get_curve_domain = CurveDomain(select_curve)
watch = Watch(get_curve_domain)
XYZ = XYZ(lacing=Longest)
number = DoubleInput(5)
number_2 = DoubleInput(0)
pi = Pi()
ellipse_arc = EllipticalArc(XYZ, number, number, number_2, pi, lacing=Longest)
get_curve_domain_2 = CurveDomain(ellipse_arc)
watch_2 = Watch(get_curve_domain_2)
