# Dynamo graph CurveFaceIntersection.dyn

select_curve = CurvesBySelection()  # 1 picked in the model
geometry_curve_from_model_curve = CurveFromModelCurve(select_curve, lacing=Longest)
select_face = FormElementBySelection()  # 1 picked in the model
curve_face_intersection = CurveFaceIntersection(geometry_curve_from_model_curve, select_face, lacing=Longest)
list = NewList(index0=curve_face_intersection.out0, index1=curve_face_intersection.out1, index2=curve_face_intersection.out2, index3=curve_face_intersection.out3, index4=curve_face_intersection.out4, index5=curve_face_intersection.out5)
watch = Watch(list)
select_curve_2 = CurvesBySelection()  # 1 picked in the model
geometry_curve_from_model_curve_2 = CurveFromModelCurve(select_curve_2, lacing=Longest)
select_face_2 = FormElementBySelection()  # 1 picked in the model
curve_face_intersection_2 = CurveFaceIntersection(geometry_curve_from_model_curve_2, select_face_2, lacing=Longest)
list_2 = NewList(index0=curve_face_intersection_2.out0, index1=curve_face_intersection_2.out1, index2=curve_face_intersection_2.out2, index3=curve_face_intersection_2.out3, index4=curve_face_intersection_2.out4, index5=curve_face_intersection_2.out5)
watch_2 = Watch(list_2)
