# Dynamo graph DividedCurve.dyn (Dynamo 0.6.3.24283)

number = DoubleInput(0..1...1)
select_curve = CurvesBySelection()  # 1 picked in the model
geometry_curve_from_model_curve = CurveFromModelCurve(select_curve, lacing=Longest)
evaluate_curve = XyzOnCurveOrEdge(number, geometry_curve_from_model_curve, lacing=Longest)
select_curve_2 = CurvesBySelection()  # 1 picked in the model
geometry_curve_from_model_curve_2 = CurveFromModelCurve(select_curve_2, lacing=Longest)
evaluate_curve_2 = XyzOnCurveOrEdge(number, geometry_curve_from_model_curve_2, lacing=Longest)
line_by_endpoints = LineBound(evaluate_curve, evaluate_curve_2, lacing=Longest)
reference_curve = ReferenceCurve(line_by_endpoints, lacing=Longest)
number_2 = DoubleInput(3)
number_3 = DoubleInput(0)
spacing_rule_layout = DividedPathSpacingRuleLayout(index=1)
divided_path = DividedPath(reference_curve, number_2, number_3, spacing_rule_layout, lacing=Longest)
transaction = Transaction(divided_path)
xyzs_from_divided_path = PointsOnDividedPath(transaction, lacing=Longest)
watch = Watch(xyzs_from_divided_path)
