# Dynamo graph DividedSurface.dyn

select_face = FormElementBySelection()  # 1 picked in the model
number = DoubleInput(5)
divided_surface = DividedSurface(select_face, number, number, lacing=Longest)
