# Dynamo graph AC_locationInDividedSurface.dyn (Dynamo 0.6.2.26765)

select_divided_surface_families = DividedSurfaceBySelection()  # 1 picked in the model
get_family_instance_location = GetFamilyInstanceLocation(select_divided_surface_families, lacing=Longest)
watch = Watch(get_family_instance_location)
