# Dynamo graph AC_locationStandAlone.dyn (Dynamo 0.6.2.26765)

select_family_instance = FamilyInstanceCreatorSelection()  # 1 picked in the model
get_family_instance_location = GetFamilyInstanceLocation(select_family_instance, lacing=Longest)
watch = Watch(get_family_instance_location)
