# Dynamo graph GetCurvesFromFamilyInstance.dyn (Dynamo 0.6.3.11146)

number = DoubleInput(0.001)
length_from_number = LengthFromNumber(number, lacing=Longest)
less_than = LessThan(arg1=length_from_number)
number_2 = DoubleInput(1)
select_family_instance = FamilyInstanceCreatorSelection()  # 1 picked in the model
curves_from_family_instance = CurvesFromFamilyInstance(select_family_instance, lacing=Longest)
evaluate_curve = XyzOnCurveOrEdge(number_2, curves_from_family_instance, lacing=Longest)
number_3 = DoubleInput(1)
select_elements = MultipleCurvesBySelection()  # 4 picked in the model
xyz_from_reference_point = XyzFromReferencePoint(select_elements, lacing=Longest)
shift_list_indices = ShiftList(number_3, xyz_from_reference_point)
reverse = Reverse(shift_list_indices)
xyz_distance = XyzDistance(evaluate_curve, reverse, lacing=Longest)
filter_out = FilterOut(less_than, xyz_distance)
watch = Watch(number)
