# Dynamo graph GetFamilyInstancesByType.dyn (Dynamo 0.7.0.17187)

select_family_type = FamilyTypeSelector(index=1)
get_family_instances_by_type = GetFamilyInstancesByType(select_family_type)
watch = Watch(get_family_instances_by_type)
