# Dynamo graph GetFamilyInstanceLocation.dyn (Dynamo 0.7.0.17187)

select_family_type = FamilyTypeSelector(index=180)
get_family_instances_by_type = GetFamilyInstancesByType(select_family_type)
get_family_instance_location = GetFamilyInstanceLocation(get_family_instances_by_type, lacing=Longest)
watch = Watch(get_family_instance_location)
average_xyz = XyzAverage()
