# Dynamo graph Length.dyn

# note: 0"
length = LengthInput(0)
watch = Watch(length)
# note: 1' 2"
length_2 = LengthInput(1.166666667)
watch_2 = Watch(length_2)
# note: 1' 2 3/16"
length_3 = LengthInput(1.182291667)
watch_3 = Watch(length_3)
# note: -8' 3/32"
length_4 = LengthInput(-8.0078125)
watch_4 = Watch(length_4)
# note: -8' 4 0/16" BAD!!!
length_5 = LengthInput(-8.333333333)
watch_5 = Watch(length_5)
