# Dynamo graph ModelCurve.dyn

xyz_zero = XYZZero()
number = DoubleInput(5)
number_2 = DoubleInput(0)
pi = Pi()
ellipse_arc = EllipticalArc(xyz_zero, number, number, number_2, pi)
z_axis = XYZBasisZ()
plane = Plane(z_axis, xyz_zero)
sketch_plane = SketchPlane(plane)
model_curve = ModelCurve(ellipse_arc, sketch_plane)
