# Dynamo graph ModelText.dyn (Dynamo 0.7.0.17877)

number = DoubleInput(2)
number_2 = DoubleInput(0..6.28..#10)
number_3 = DoubleInput(-1.57..1.57..#10)
X = Formula("p*sin(theta)*cos(beta)", p=number, theta=number_2, beta=number_3, lacing=CrossProduct)
Y = Formula("p*cos(theta)*cos(beta)", p=number, theta=number_2, beta=number_3, lacing=CrossProduct)
Z = Formula("p*sin(beta)", p=number, beta=number_3, lacing=Longest)
number_4 = DoubleInput(10)
repeat = Repeat(Z, number_4, lacing=Longest)
transpose_lists = Transpose(repeat)
flatten_completely = FlattenList(transpose_lists)
XYZ = Xyz(X, Y, flatten_completely, lacing=Longest)
list_length = Length(XYZ)
number_5 = DoubleInput(0..a, list_length, lacing=Longest)
number_to_string = Num2String(number_5, lacing=Longest)
xyz_zero = XyzZero(lacing=Longest)
xyz_start_end_vector = XyzStartEndVector(xyz_zero, XYZ, lacing=Longest)
z_axis = XyzBasisZ(lacing=Longest)
negate_xyz = XyzNegate(z_axis, lacing=Longest)
number_6 = DoubleInput(0.25)
string = StringInput("Model Text 1")
model_text = ModelText(number_to_string, XYZ, xyz_start_end_vector, negate_xyz, number_6, string, lacing=Longest)
watch = Watch(XYZ)
watch_2 = Watch(repeat)
