# Dynamo graph OffsetCurves.dyn

xyz_zero = XYZZero()
number = DoubleInput(3)
number_2 = DoubleInput(5)
ellipse = Ellipse(xyz_zero, number, number_2)
watch_3d = Watch3D()
number_3 = DoubleInput(0)
XYZ = XYZ(number_3, number_3, number_3)
number_4 = DoubleInput(1)
XYZ_2 = XYZ(number_4, number_3, number_4)
number_5 = DoubleInput(2)
XYZ_3 = XYZ(number_5, number_3, number_3)
number_6 = DoubleInput(3)
XYZ_4 = XYZ(number_6, number_3, number_4)
list = NewList(item_s=XYZ, index1=XYZ_2, index2=XYZ_3, index3=XYZ_4)
nurbs_spline = GeometryCurveNurbSpline(list)
number_7 = DoubleInput(0.01)
y_axis = XYZBasisY()
offset_curve = OffsetCrv(nurbs_spline, number_7, y_axis)
watch_3d_2 = Watch3D(offset_curve)
pi = Pi()
number_8 = DoubleInput(1.5)
multiply = Multiplication(pi, number_8)
arc_by_ctr_pt = ArcCenter(xyz_zero, number, number_3, multiply)
z_axis = XYZBasisZ()
offset_curve_2 = OffsetCrv(arc_by_ctr_pt, number_7, z_axis)
watch_3d_3 = Watch3D(offset_curve_2)
hermite_spline = HermiteSpline(list)
watch_3d_4 = Watch3D(hermite_spline)
offset_curve_3 = OffsetCrv(hermite_spline, number_7, y_axis)
