# Dynamo graph OverrideElementColorInView.dyn (Dynamo 0.7.0.26273)

number = DoubleInput(255)
select_family_type = FamilyTypeSelector(index=1)
get_family_instances_by_type = GetFamilyInstancesByType(select_family_type)
list_length = Length(get_family_instances_by_type)
number_2 = DoubleInput(1..length, list_length, lacing=Longest)
number_3 = DoubleInput(length..1, list_length, lacing=Longest)
formula = Formula("(a/b)*c", a=number_3, b=list_length, c=number, lacing=Longest)
formula_2 = Formula("(a/b)*c", a=number_2, b=list_length, c=number, lacing=Longest)
color = Color(number, number_2, formula, formula_2, lacing=Longest)
override_element_color_in_view = OverrideColorInView(color, get_family_instances_by_type, lacing=Longest)
