# Dynamo graph RayBounce.dyn (Dynamo 0.7.0.39621)

model_curve = ModelCurve(lacing=Longest)
number = DoubleInput(0)
number_2 = DoubleInput(20)
number_3 = DoubleInput(8)
XYZ = Xyz(number, number_2, number_3, lacing=Longest)
number_4 = DoubleInput(1)
circle = Circle(XYZ, number_4, lacing=Longest)
number_5 = DoubleInput(12)
xyz_array_on_curve = XyzArrayAlongCurve(circle, number_5, lacing=Longest)
number_6 = DoubleInput(0)
number_7 = DoubleInput(-0.8)
XYZ_2 = Xyz(number_6, number_6, number_7, lacing=Longest)
add_xyz = XyzAdd(xyz_array_on_curve, XYZ_2, lacing=Longest)
xyz_start_end_vector = XyzStartEndVector(XYZ, add_xyz, lacing=Longest)
number_8 = DoubleInput(3)
get_active_view = ActiveRevitView(lacing=Longest)
ray_bounce = RayBounce(XYZ, xyz_start_end_vector, number_8, get_active_view, lacing=Longest)
lines_through_xyz = CurvesThroughPoints(ray_bounce.out0, lacing=Longest)
map = Map(model_curve, lines_through_xyz)
watch = Watch(ray_bounce.out1)
