# Dynamo graph ReferencePlane.dyn (Dynamo 0.6.2.24371)

XYZ = Xyz(lacing=Longest)
number = DoubleInput(20)
integer_slider = IntegerSliderInput(5, range=0..20)
number_2 = DoubleInput(0..3.14..#div, integer_slider, lacing=Longest)
number_3 = DoubleInput(0)
xyz_by_polar_coordinates = XyzFromPolar(number, number_2, number_3, lacing=Longest)
line_by_endpoints = LineBound(XYZ, xyz_by_polar_coordinates, lacing=Longest)
concat_strings = ConcatStrings()
string = StringInput("testPlane_")
list_length = Length(number_2)
repeat = Repeat(string, list_length, lacing=Longest)
number_to_string = Num2String(number_2, lacing=Longest)
combine = Combine(concat_strings, repeat, number_to_string)
reference_plane = ReferencePlane(line_by_endpoints, combine, lacing=Longest)
