# Dynamo graph circle.dyn (Dynamo 0.6.2.28307)

number_slider = DoubleSliderInput(0, range=0..100)
number = DoubleInput(0)
XYZ = Xyz(number_slider, number, number, lacing=Longest)
number_slider_2 = DoubleSliderInput(40.909, range=0..100)
circle = Circle(XYZ, number_slider_2, lacing=Longest)
model_curve = ModelCurve(circle, lacing=Longest)
z_axis = XyzBasisZ(lacing=Longest)
plane = Plane(z_axis, XYZ, lacing=Longest)
sketch_plane = SketchPlane(plane, lacing=Longest)
select_curve = CurvesBySelection()  # 1 picked in the model
curve_from_curve_element = CurveFromModelCurve(select_curve, lacing=Longest)
list = NewList(index0=circle, index1=curve_from_curve_element)
watch_3d = Watch3D(list)
