# Dynamo graph connect two point arrays without python.dyn (Dynamo 0.6.2.28307)

boolean = BoolSelector(true)
curve_by_points = CurveByPoints(arg1=boolean, lacing=Longest)
list = NewList()
curve_by_selection = CurvesBySelection()  # 1 picked in the model
number_slider = DoubleSliderInput(4.267, range=0..20)
xyz_array_along_curve = XyzArrayAlongCurve(curve_by_selection, number_slider, lacing=Longest)
reference_point = ReferencePointByXyz(xyz_array_along_curve, lacing=Longest)
curve_by_selection_2 = CurvesBySelection()  # 1 picked in the model
xyz_array_along_curve_2 = XyzArrayAlongCurve(curve_by_selection_2, number_slider, lacing=Longest)
reference_point_2 = ReferencePointByXyz(xyz_array_along_curve_2, lacing=Longest)
combine = Combine(list, reference_point, reference_point_2)
map = Map(curve_by_points, combine)
