# Dynamo graph Loft.dyn

boolean = BoolSelector(true)
xyz_zero = XYZZero()
number = DoubleInput(5)
number_2 = DoubleInput(0)
pi = Pi()
ellipse_arc = EllipticalArc(xyz_zero, number, number, number_2, pi)
z_axis = XYZBasisZ()
plane = Plane(z_axis, xyz_zero)
sketch_plane = SketchPlane(plane)
reference_curve = ReferenceCurve(ellipse_arc, sketch_plane)
XYZ = XYZ(number_2, number_2, number)
ellipse_arc_2 = EllipticalArc(XYZ, number, number, number_2, pi)
plane_2 = Plane(z_axis, XYZ)
sketch_plane_2 = SketchPlane(plane_2)
reference_curve_2 = ReferenceCurve(ellipse_arc_2, sketch_plane_2)
list = NewList(index0=reference_curve, index1=reference_curve_2)
loft_form = LoftForm(boolean, list, boolean)
