# Dynamo graph SweepToMakeSolid.dyn (Dynamo 0.6.2.30446)

number = DoubleInput(0)
XYZ = Xyz(number, number, number, lacing=Longest)
number_2 = DoubleInput(1)
XYZ_2 = Xyz(number_2, number, number, lacing=Longest)
XYZ_3 = Xyz(number, number, number_2, lacing=Longest)
transf_from_origin_and_vecs = TransformOriginAndVectors(XYZ, XYZ_2, XYZ_3, lacing=Longest)
number_3 = DoubleInput(20)
number_4 = DoubleInput(50)
ellipse_arc = EllipticalArc(transf_from_origin_and_vecs, number_3, number_4, number, number_2, lacing=Longest)
list = NewList(index0=ellipse_arc)
curve_loop = CurveLoop(list, lacing=Longest)
number_5 = DoubleInput(10)
XYZ_4 = Xyz(number_5, number_5, number, lacing=Longest)
XYZ_5 = Xyz(number_3, number_4, number, lacing=Longest)
list_2 = NewList(index0=XYZ, index1=XYZ_4, index2=XYZ_5)
hermite_spline = HermiteSpline(list_2, lacing=Longest)
line = LineBound(XYZ_5, XYZ, lacing=Longest)
list_3 = NewList(index0=hermite_spline, index1=line)
curve_loop_2 = CurveLoop(list_3, lacing=Longest)
create_swept_geometry = CreateSweptGeometry(curve_loop, curve_loop_2, lacing=Longest)
watch = Watch(create_swept_geometry)
