# Dynamo graph SweepToMakeSolid.dyn

number = DoubleInput(0)
number_2 = DoubleInput(0)
XYZ = XYZ(number_2, number_2, number_2, lacing=Longest)
number_3 = DoubleInput(1)
XYZ_2 = XYZ(number_3, number_2, number_2, lacing=Longest)
XYZ_3 = XYZ(number_2, number_2, number_3, lacing=Longest)
transf_from_origin_and_vecs = TransformOriginAndVectors(XYZ, XYZ_2, XYZ_3, lacing=Longest)
number_4 = DoubleInput(20)
number_5 = DoubleInput(50)
ellipse_arc = EllipticalArc(transf_from_origin_and_vecs, number_4, number_5, number_2, number_3, lacing=Longest)
list = NewList(index0=ellipse_arc)
curve_loop = CurveLoop(list, lacing=Longest)
number_6 = DoubleInput(10)
XYZ_4 = XYZ(number_6, number_6, number_2, lacing=Longest)
XYZ_5 = XYZ(number_4, number_5, number_2, lacing=Longest)
list_2 = NewList(index0=XYZ, index1=XYZ_4, index2=XYZ_5)
hermite_spline = HermiteSpline(list_2, lacing=Longest)
line = LineBound(XYZ_5, XYZ, lacing=Longest)
list_3 = NewList(index0=hermite_spline, index1=line)
curve_loop_2 = CurveLoop(list_3, lacing=Longest)
curve_loop_list = ListCurveLoop(curve_loop_2, lacing=Longest)
curve_loop_3 = CurveLoop(curve_loop_list, lacing=Longest)
create_swept_geometry = CreateSweptGeometry(curve_loop, number_2, number_2, curve_loop_3, lacing=Longest)
watch = Watch(create_swept_geometry)
