# Dynamo graph SweptBlend.dyn (Dynamo 0.6.2.15368)

identity_transform = TransformIdentity(lacing=Longest)
number = DoubleInput(10)
number_2 = DoubleInput(20)
rectangle = Rectangle(identity_transform, number, number_2, lacing=Longest)
number_3 = DoubleInput(0)
XYZ = Xyz(number, number_3, number_2, lacing=Longest)
number_4 = DoubleInput(0.4)
scale_xyz = XyzScale(XYZ, number_4, lacing=Longest)
translate_transform = TransformTranslation(scale_xyz, lacing=Longest)
number_5 = DoubleInput(15)
rectangle_2 = Rectangle(translate_transform, number, number_5, lacing=Longest)
translate_transform_2 = TransformTranslation(XYZ, lacing=Longest)
rectangle_3 = Rectangle(translate_transform_2, number_2, number, lacing=Longest)
list = NewList(index0=rectangle, index1=rectangle_2, index2=rectangle_3)
XYZ_2 = Xyz(number, number_3, number_3, lacing=Longest)
line = LineBound(XYZ_2, XYZ, lacing=Longest)
create_swept_blend_geometry = CreateSweptBlendGeometry(list, line, lacing=Longest)
watch = Watch(create_swept_blend_geometry)
free_form = FreeForm(create_swept_blend_geometry, lacing=Longest)
