# Dynamo graph UVRandom.dyn

number = DoubleInput(0)
UV = UV(number, number, lacing=Longest)
number_2 = DoubleInput(1)
UV_2 = UV(number_2, number_2, lacing=Longest)
domain_2d = Domain2D(UV, UV_2)
number_3 = DoubleInput(5)
uv_random = UVRandom(domain_2d, number_3, number_3)
