# Dynamo graph ViewSheet.dyn (Dynamo 0.7.0.17877)

number = DoubleInput(2)
number_2 = DoubleInput(-1.57..1.57..#10)
Z = Formula("p*sin(beta)", p=number, beta=number_2, lacing=Longest)
number_3 = DoubleInput(10)
repeat = Repeat(Z, number_3, lacing=Longest)
watch = Watch(repeat)
select_family_type = FamilyTypeSelector(index=178)
number_4 = DoubleInput(0..6.28..#10)
X = Formula("p*sin(theta)*cos(beta)", p=number, theta=number_4, beta=number_2, lacing=CrossProduct)
Y = Formula("p*cos(theta)*cos(beta)", p=number, theta=number_4, beta=number_2, lacing=CrossProduct)
transpose_lists = Transpose(repeat)
flatten_completely = FlattenList(transpose_lists)
XYZ = Xyz(X, Y, flatten_completely, lacing=Longest)
xyz_zero = XyzZero(lacing=Longest)
xyz_start_end_vector = XyzStartEndVector(XYZ, xyz_zero, lacing=Longest)
number_5 = DoubleInput(2)
scale_xyz = XyzScale(xyz_start_end_vector, number_5, lacing=Longest)
subtract_xyz = XyzSubtract(XYZ, scale_xyz, lacing=Longest)
list_length = Length(XYZ)
number_6 = DoubleInput(0..a, list_length, lacing=Longest)
number_to_string = Num2String(number_6, lacing=Longest)
boolean = BoolSelector(true)
axonometric_view = IsometricView(subtract_xyz, XYZ, number_to_string, arg4=boolean, lacing=Longest)
view_sheet = ViewSheet(arg2=select_family_type, arg3=axonometric_view, lacing=Longest)
concat_strings = ConcatStrings()
string = StringInput("test sheet")
list = NewList(index0=string)
cartesian_product = CartProd(concat_strings, list, number_to_string)
