# Dynamo graph XYZToSphericalCoordinates.dyn (Dynamo 0.6.2.17383)

number = DoubleInput(2)
number_2 = DoubleInput(1.2)
number_3 = DoubleInput(1)
xyz_by_spherical_coordinates = XyzFromSpherical(number, number_2, number_3, lacing=Longest)
xyz_to_spherical_coordinates = XyzToSpherical(xyz_by_spherical_coordinates, lacing=Longest)
xyz_by_spherical_coordinates_2 = XyzFromSpherical(xyz_to_spherical_coordinates.out0, xyz_to_spherical_coordinates.out1, xyz_to_spherical_coordinates.out2, lacing=Longest)
