# Dynamo graph CurveByPointsByLine.dyn

xyz_zero = XYZZero(lacing=Longest)
number = DoubleInput(2, lacing=Longest)
number_slider = DoubleSliderInput(8.764044944, range=0..10, lacing=Longest)
XYZ = XYZ(number, number_slider, number, lacing=Longest)
line = LineBound(xyz_zero, XYZ, lacing=Longest)
curve_by_points_by_line = CurveByPointsByLine(line, lacing=Longest)
