# Dynamo graph LacingTest.dyn

number = DoubleInput(0, lacing=Longest)
number_2 = DoubleInput(3, lacing=Longest)
number_3 = DoubleInput(1, lacing=Longest)
number_sequence = BuildSeq(number, number_2, number_3, lacing=Longest)
number_4 = DoubleInput(4, lacing=Longest)
number_sequence_2 = BuildSeq(number, number_4, number_3, lacing=Longest)
XYZ = XYZ(number, number_sequence, number_sequence_2, lacing=CrossProduct)
ref_point = ReferencePointByXYZ(XYZ, lacing=Longest)
list_length = Length(ref_point, lacing=Longest)
watch = Watch(list_length)
