# Dynamo graph LacingTest_noRevit.dyn

number = DoubleInput(0, lacing=Longest)
number_2 = DoubleInput(4, lacing=Longest)
number_3 = DoubleInput(1, lacing=Longest)
number_sequence = BuildSeq(number, number_2, number_3, lacing=Longest)
number_4 = DoubleInput(5, lacing=Longest)
number_sequence_2 = BuildSeq(number, number_4, number_3, lacing=Longest)
formula = Formula("x+y", x=number_sequence, y=number_sequence_2, lacing=CrossProduct)
list_length = Length(formula, lacing=Longest)
watch = Watch(list_length)
