# Dynamo graph AC_byCurve.dyn

list = NewList()
select_curve = CurvesBySelection()  # 1 picked in the model
curve_from_curve_element = CurveFromModelCurve(select_curve, lacing=Longest)
curve_domain = CurveDomain(curve_from_curve_element)
number = DoubleInput(2)
number_range = NumberRange(curve_domain.out0, curve_domain.out1, number, lacing=Longest)
map = Map(list, number_range)
select_family_type = FamilyTypeSelector(index=8)
adaptive_component_by_parameter = AdaptiveComponentByParametersOnCurve(map, curve_from_curve_element, select_family_type, lacing=Longest)  # "Adaptive Component by Parameter on Curve"
watch = Watch(curve_domain.out1)
