# Dynamo graph AC_byFace.dyn

list = NewList()
select_face = FormElementBySelection()  # 1 picked in the model
surface_domain = SurfaceDomain(select_face)
number = DoubleInput(10)
uv_grid = UVGrid(surface_domain.out0, number, number)
map = Map(list, uv_grid)
select_family_type = FamilyTypeSelector(index=8)
adaptive_component_by_uvs_on = AdaptiveComponentByUvsOnFace(map, select_face, select_family_type, lacing=CrossProduct)
list_2 = NewList(index0=surface_domain.out0, index1=surface_domain.out1, index2=surface_domain.out2, index3=surface_domain.out3)
watch = Watch(list_2)
