# Dynamo graph face_domain.dyn

select_face = FormElementBySelection()  # 1 picked in the model
surface_domain = SurfaceDomain(select_face)
watch = Watch(surface_domain.out0)
watch_2 = Watch(surface_domain.out1)
watch_3 = Watch(surface_domain.out3)
watch_4 = Watch(surface_domain.out2)
