# Dynamo graph graph.dyn (Dynamo 3.4.0.6124)
# packages: Package1 1.0.0, Package2 1.0.0

number = DoubleInput(29)
list_create = List.Create(item0=number, item1=number, item2=number)
serializeSomething = TestAssemblyIsolationNamespace2.TestAssemblyIsolationClass2.SerializeSomething(obj=list_create)
deserializeSomething = TestAssemblyIsolationNamespace2.TestAssemblyIsolationClass2.DeserializeSomething(input=serializeSomething)
watch = Watch(deserializeSomething)
serializeSomething_2 = TestAssemblyIsolationNamespace1.TestAssemblyIsolationClass1.SerializeSomething(obj=list_create)
deserializeSomething_2 = TestAssemblyIsolationNamespace1.TestAssemblyIsolationClass1.DeserializeSomething(input=serializeSomething_2)
watch_2 = Watch(deserializeSomething_2)
