# Dynamo graph 12-IsovistTest_OOTB.dyn (Dynamo 2.3.0.4415)

# group: ISOVIST TEST Refinery Graph Example
# note: DYNAMO PROJECT
# REFINERY_ISOVIST_TEST
# note: ASSOCIATED FILE(S)
# N/A
# note: AUTHOR(S) / CREATION DATE
# Refinery Team and The Proving Ground / Dec 2018
# note: DYNAMO VERSION
# 2.0.2
# note: ADDITIONAL COMMENTS
# N/A
# note: REQUIRED DYNAMO PACKAGES
# Lunchbox for Dynamo - v2018.7.6
# Note:
# The Lunchbox installation instructions are now the txt file in the Extra folder. To install Lunchbox you have to use an external installer in liue of the Package Manager.
# note: DESCRIPTION
# Maximize visibility of objects from one or more points in a room through a collision test between isovists and barrier objects.
# This is a great tool to optimize views to patients from nurse work stations. This can be especially important in cases like dialysis clinics where nurses need to be able to have visibility of all patients when obstacles such as RO water cabinets are located between patients. Additional visibility optimization scenarios are possible.

# group: Input: Changeable variables
# note: Variables / Inputs
# Red indicates Variables that can be altered per project and must be set accordingly before running the script.
# note: NOTE:
# In order to see an 'Input' in Refinery, you have to right-click on a compatible node and check the 'Is Input' option. Rename the node to see a legible input name in Refinery.
hall_width = IntegerSlider(8, range=8..10 step 1)  # graph input
# note: Working / Functions
# Green indicates the working of the script. No changes should be made in these groups unless advised.
room_depth = IntegerSlider(8, range=8..14 step 1)  # graph input
cabinet_width_1 = DoubleSlider(1, range=0.6..1.6 step 0.1)  # graph input
cabinet_width_2 = DoubleSlider(1.1, range=0.6..1.6 step 0.1)
cabinet_width_3 = DoubleSlider(0.7, range=0.6..1.6 step 0.1)  # graph input
cabinet_width_4 = DoubleSlider(1, range=0.6..1.6 step 0.1)  # graph input
cabinet_gap_1 = IntegerSlider(3, range=2..6 step 1)  # graph input
cabinet_gap_2 = IntegerSlider(4, range=2..6 step 1)  # graph input
cabinet_gap_3 = IntegerSlider(3, range=2..6 step 1)  # graph input
cabinet_gap_4 = IntegerSlider(5, range=2..6 step 1)  # graph input
cabinet_rotation_1 = IntegerSlider(82, range=75..105 step 1)  # graph input
# note: Checking / Outputs
# Orange indicates checking nodes to ensure the script has deployed correctly.
cabinet_rotation_2 = IntegerSlider(95, range=75..105 step 1)  # graph input
cabinet_rotation_3 = IntegerSlider(88, range=75..105 step 1)  # graph input
cabinet_rotation_4 = IntegerSlider(76, range=75..105 step 1)  # graph input

# group: RO Cabinets
code_block = CodeBlock { a = 20; b = -a; }
byCoordinates = Point.ByCoordinates(y=code_block.a)
byCoordinates_2 = Point.ByCoordinates(y=code_block.b)
byStartPointEndPoint = Line.ByStartPointEndPoint(startPoint=byCoordinates, endPoint=byCoordinates_2)
XAxis = Vector.XAxis()
translate = Geometry.Translate(geometry=byStartPointEndPoint, direction=XAxis, distance=hall_width)
code_block_2 = CodeBlock { start = 1; amt = 10; rng = 0..1..#amt; key = "Points"; }
pointAtParameter = Curve.PointAtParameter(curve=translate, param=code_block_2.rng)
slice = List.Slice(list=pointAtParameter, start=code_block_2.start, end=code_block_2.amt)
code_block_3 = CodeBlock { 2; }
dropEveryNthItem = List.DropEveryNthItem(list=slice, n=code_block_3)
list_create = List.Create(item0=cabinet_width_1, item1=cabinet_width_2, item2=cabinet_width_3, item3=cabinet_width_4)
list_create_2 = List.Create(item0=cabinet_gap_1, item1=cabinet_gap_2, item2=cabinet_gap_3, item3=cabinet_gap_4)
code_block_4 = CodeBlock(g=list_create, z=list_create_2) { 2; 4; w=(g*2); l=(2/g)*2; a=(z+l)/2; }
translate_2 = Geometry.Translate(geometry=dropEveryNthItem, direction=XAxis, distance=code_block_4.a)
ZAxis = Vector.ZAxis()
translate_3 = Geometry.Translate(geometry=translate_2, direction=ZAxis, distance=code_block_4.out1)
byLengths = Cuboid.ByLengths(origin=translate_3, width=code_block_4.w, length=code_block_4.l, height=code_block_4.out0)
byOriginNormal = Plane.ByOriginNormal(origin=translate_2, normal=ZAxis)
list_create_3 = List.Create(item0=cabinet_rotation_1, item1=cabinet_rotation_2, item2=cabinet_rotation_3, item3=cabinet_rotation_4)
rotate = Geometry.Rotate(geometry=byLengths, basePlane=byOriginNormal, degrees=list_create_3)
watch = Watch(code_block_4.l)

# group: Patient
XAxis_2 = Vector.XAxis()
code_block_5 = CodeBlock(x=room_depth) { y=(x/2); }
translate_4 = Geometry.Translate(geometry=translate, direction=XAxis_2, distance=code_block_5)
code_block_6 = CodeBlock { num = 2; amt = 10; rng = 0..1..#amt; }
pointAtParameter_2 = Curve.PointAtParameter(curve=translate_4, param=code_block_6.rng)
dropEveryNthItem_2 = List.DropEveryNthItem(list=pointAtParameter_2, n=code_block_6.num)
X = Point.X(point=dropEveryNthItem_2)
Y = Point.Y(point=dropEveryNthItem_2)
code_block_7 = CodeBlock { 4.5; 0.5; }
byCoordinates_3 = Point.ByCoordinates(x=X, y=Y, z=code_block_7.out0)
byPointsRadius = Cylinder.ByPointsRadius(startPoint=dropEveryNthItem_2, endPoint=byCoordinates_3, radius=code_block_7.out1)
patient_1 = List.FirstItem(list=byPointsRadius)
code_block_8 = CodeBlock { 1; 2; 3; }
patient_2 = List.GetItemAtIndex(list=byPointsRadius, index=code_block_8.out0)
patient_3 = List.GetItemAtIndex(list=byPointsRadius, index=code_block_8.out1)
patient_4 = List.GetItemAtIndex(list=byPointsRadius, index=code_block_8.out2)
patient_5 = List.LastItem(list=byPointsRadius)

# group: Nurse View Points
code_block_9 = CodeBlock { a=20; b=-a; 3.5; }
byCoordinates_4 = Point.ByCoordinates(y=code_block_9.a, z=code_block_9.out2)
byCoordinates_5 = Point.ByCoordinates(y=code_block_9.b, z=code_block_9.out2)
byStartPointEndPoint_2 = Line.ByStartPointEndPoint(startPoint=byCoordinates_4, endPoint=byCoordinates_5)
code_block_10 = CodeBlock { amt = 7; rng = 0..1..#amt+1; 2; 3; }
pointAtParameter_3 = Curve.PointAtParameter(curve=byStartPointEndPoint_2, param=code_block_10.rng)
getItemAtIndex = List.GetItemAtIndex(list=pointAtParameter_3, index=code_block_10.out2)
getItemAtIndex_2 = List.GetItemAtIndex(list=pointAtParameter_3, index=code_block_10.out3)

# group: Walls
translate_5 = Geometry.Translate(geometry=translate, direction=XAxis_2, distance=room_depth)
startPoint = Curve.StartPoint(curve=translate_5)
startPoint_2 = Curve.StartPoint(curve=translate)
ZAxis_2 = Vector.ZAxis()
code_block_11 = CodeBlock { 8; 1; -1; }
translate_6 = Geometry.Translate(geometry=startPoint_2, direction=ZAxis_2, distance=code_block_11.out0)
YAxis = Vector.YAxis()
translate_7 = Geometry.Translate(geometry=translate_6, direction=YAxis, distance=code_block_11.out1)
byCorners = Cuboid.ByCorners(lowPoint=startPoint, highPoint=translate_7)
endPoint = Curve.EndPoint(curve=translate)
endPoint_2 = Curve.EndPoint(curve=translate_5)
translate_8 = Geometry.Translate(geometry=endPoint_2, direction=ZAxis_2, distance=code_block_11.out0)
translate_9 = Geometry.Translate(geometry=translate_8, direction=YAxis, distance=code_block_11.out2)
byCorners_2 = Cuboid.ByCorners(lowPoint=endPoint, highPoint=translate_9)
translate_10 = Geometry.Translate(geometry=startPoint, direction=YAxis, distance=code_block_11.out1)
XAxis_3 = Vector.XAxis()
translate_11 = Geometry.Translate(geometry=translate_9, direction=XAxis_3, distance=code_block_11.out1)
byCorners_3 = Cuboid.ByCorners(lowPoint=translate_10, highPoint=translate_11)
list_create_4 = List.Create(item0=byCorners, item1=byCorners_2, item2=byCorners_3)
byUnion = Solid.ByUnion(solids=list_create_4)

# group: Isovist
code_block_12 = CodeBlock { 100; 255; 75; 100; }
union = Solid.Union(solid=byUnion, solid_2=rotate)

code_block_13 = CodeBlock(origin=getItemAtIndex, radius=code_block_12.out0, startAngle=code_block_12.out1, endAngle=code_block_12.out2, rayCount=code_block_12.out3, boundaries=union) { origin; radius; startAngle; endAngle; rayCount; boundaries; }
code_block_14 = CodeBlock(startpoint=code_block_13.origin) { startpoint; }
XAxis_4 = Vector.XAxis()
reverse = Vector.Reverse(vector=XAxis_4)
ZAxis_3 = Vector.ZAxis()
code_block_15 = CodeBlock(x=code_block_13.rayCount) { x+1; }
sub = code_block_13.endAngle - code_block_13.startAngle
div = sub / code_block_13.rayCount
sequence = Sequence(amount=code_block_15, step=div)
add = code_block_13.startAngle + sequence
rotate_2 = Vector.Rotate(vector=reverse, axis=ZAxis_3, degrees=add)
byStartPointDirectionLength = Line.ByStartPointDirectionLength(startPoint=code_block_14, direction=rotate_2, length=code_block_13.radius)
code_block_16 = CodeBlock { 1; }
explode = Geometry.Explode(geometry=code_block_13.boundaries)
flatten = List.Flatten(list=explode)
count = List.Count(list=flatten)
ofRepeatedItem = List.OfRepeatedItem(item=code_block_16, amount=count)
doesIntersect = Geometry.DoesIntersect(geometry=byStartPointDirectionLength, other=flatten, lacing=CrossProduct)
filterByBoolMask = List.FilterByBoolMask(list=ofRepeatedItem, mask=doesIntersect@L2)
sum = Math.Sum(values=filterByBoolMask.in)
code_block_17 = CodeBlock { 0; }
gt = sum > code_block_17
filterByBoolMask_2 = List.FilterByBoolMask(list=byStartPointDirectionLength, mask=gt)
flatten_2 = List.Flatten(list=filterByBoolMask_2.in)
intersect = Geometry.Intersect(geometry=flatten_2, other=flatten, lacing=CrossProduct)
flatten_3 = List.Flatten(list=intersect@L3)
distanceTo = Geometry.DistanceTo(geometry=code_block_14, other=flatten_3)
sortByKey = List.SortByKey(list=flatten_3@L2, keys=distanceTo@L2)
code_block_18 = CodeBlock { 0; }
getItemAtIndex_3 = List.GetItemAtIndex(list=sortByKey.sorted_list@L2, index=code_block_18)
byStartPointEndPoint_3 = Line.ByStartPointEndPoint(startPoint=code_block_14, endPoint=getItemAtIndex_3)

# group (continued): Isovist
length = Curve.Length(curve=byStartPointEndPoint_3)
code_block_19 = CodeBlock(x=length, y=byStartPointEndPoint_3) { x==100?null:y; }
nurse_a_view_rays = List.Flatten(list=code_block_19)

code_block_20 = CodeBlock(origin=getItemAtIndex_2, radius=code_block_12.out0, startAngle=code_block_12.out1, endAngle=code_block_12.out2, rayCount=code_block_12.out3, boundaries=union) { origin; radius; startAngle; endAngle; rayCount; boundaries; }
code_block_21 = CodeBlock(startpoint=code_block_20.origin) { startpoint; }
XAxis_5 = Vector.XAxis()
reverse_2 = Vector.Reverse(vector=XAxis_5)
ZAxis_4 = Vector.ZAxis()
code_block_22 = CodeBlock(x=code_block_20.rayCount) { x+1; }
sub_2 = code_block_20.endAngle - code_block_20.startAngle
div_2 = sub_2 / code_block_20.rayCount
sequence_2 = Sequence(amount=code_block_22, step=div_2)
add_2 = code_block_20.startAngle + sequence_2
rotate_3 = Vector.Rotate(vector=reverse_2, axis=ZAxis_4, degrees=add_2)
byStartPointDirectionLength_2 = Line.ByStartPointDirectionLength(startPoint=code_block_21, direction=rotate_3, length=code_block_20.radius)
code_block_23 = CodeBlock { 1; }
explode_2 = Geometry.Explode(geometry=code_block_20.boundaries)
flatten_4 = List.Flatten(list=explode_2)
count_2 = List.Count(list=flatten_4)
ofRepeatedItem_2 = List.OfRepeatedItem(item=code_block_23, amount=count_2)
doesIntersect_2 = Geometry.DoesIntersect(geometry=byStartPointDirectionLength_2, other=flatten_4, lacing=CrossProduct)
filterByBoolMask_3 = List.FilterByBoolMask(list=ofRepeatedItem_2, mask=doesIntersect_2@L2)
sum_2 = Math.Sum(values=filterByBoolMask_3.in)
code_block_24 = CodeBlock { 0; }
gt_2 = sum_2 > code_block_24
filterByBoolMask_4 = List.FilterByBoolMask(list=byStartPointDirectionLength_2, mask=gt_2)
flatten_5 = List.Flatten(list=filterByBoolMask_4.in)
intersect_2 = Geometry.Intersect(geometry=flatten_5, other=flatten_4, lacing=CrossProduct)
flatten_6 = List.Flatten(list=intersect_2@L3)
distanceTo_2 = Geometry.DistanceTo(geometry=code_block_21, other=flatten_6)
sortByKey_2 = List.SortByKey(list=flatten_6@L2, keys=distanceTo_2@L2)
code_block_25 = CodeBlock { 0; }
getItemAtIndex_4 = List.GetItemAtIndex(list=sortByKey_2.sorted_list@L2, index=code_block_25)
byStartPointEndPoint_4 = Line.ByStartPointEndPoint(startPoint=code_block_21, endPoint=getItemAtIndex_4)

# group (continued): Isovist
length_2 = Curve.Length(curve=byStartPointEndPoint_4)
code_block_26 = CodeBlock(x=length_2, y=byStartPointEndPoint_4) { x==100?null:y; }
nurse_b_view_rays = List.Flatten(list=code_block_26)

# group: Collision Test
doesIntersect_3 = Geometry.DoesIntersect(geometry=byPointsRadius, other=nurse_a_view_rays, lacing=CrossProduct)
countTrue = List.CountTrue(list=doesIntersect_3@L2)
code_block_27 = CodeBlock(x=countTrue) { x>0?1:0; }
nurse_a_no_patients_visible = Math.Sum(values=code_block_27)
doesIntersect_4 = Geometry.DoesIntersect(geometry=byPointsRadius, other=nurse_b_view_rays, lacing=CrossProduct)
countTrue_2 = List.CountTrue(list=doesIntersect_4@L2)
code_block_28 = CodeBlock(x=countTrue_2) { x>0?1:0; }
nurse_b_no_patients_visible = Math.Sum(values=code_block_28)

code_block_29 = CodeBlock(A=nurse_a_no_patients_visible, B=nurse_b_no_patients_visible) { A+B; }

# group: Area
length_3 = Curve.Length(curve=byStartPointEndPoint)
code_block_30 = CodeBlock(x=hall_width, y=room_depth, b=length_3) { a=(x+y+6)*b; }

# group: Outputs: Output information that can be used to filter results in Refinery
# note: NOTE:
# In order to see an 'Output' in Refinery, you have to right-click on a compatible node and check the 'Is
# Output' option. Rename the node to see a legible output name in Refinery.
nurses_no_patients_visible = Watch(code_block_29)  # graph output
dialysis_bay_area = Watch(code_block_30)  # graph output

# group: Visualization: Colourizes Dynamo geometry in the Background Preview window
color_palette = ColorPalette({R: 5, G: 195, B: 222, A: 255})
byGeometryColor = Modifiers.GeometryColor.ByGeometryColor(geometry=nurse_a_view_rays, color=color_palette)
color_palette_2 = ColorPalette({R: 255, G: 138, B: 61, A: 255})
byGeometryColor_2 = Modifiers.GeometryColor.ByGeometryColor(geometry=nurse_b_view_rays, color=color_palette_2)
