# Dynamo graph CurveParameterAtPointQA_2.7.0_1.dyn (Dynamo 2.10.0.3005)

file_path = Filename("data\test_data_CurveParameterAtPoint.xlsx")
sheet_name = StringInput("Sheet1")

# group: Process data from excel
file_from_path = FileObject(path=file_path)
importExcel = Data.ImportExcel(file=file_from_path, sheetName=sheet_name)
code_block = CodeBlock(ls=importExcel) { ls1=List.DropItems(ls,1); List.Transpose(ls1); }
code_block_2 = CodeBlock(ls=code_block.out1) { station=ls[0]; x=ls[1]; y=ls[2]; z=ls[3]; r=ls[4]; cvType=ls[5]; cvSide=ls[6]; e=ls[7]; }
code_block_3 = CodeBlock(lsx=code_block_2.x, lsy=code_block_2.y, z=code_block_2.z) { x0=List.MinimumItem(lsx); y0=List.MinimumItem(lsy); x=lsx-x0; y=lsy-y0; z; }

# group: Geometry calculation
byCoordinates = Point.ByCoordinates(x=code_block_3.x, y=code_block_3.y, z=code_block_3.z)
pruneDuplicates = Point.PruneDuplicates(points=byCoordinates)
code_block_polycurve = CodeBlock(pts=pruneDuplicates)  # "Code Block: PolyCurve.ParameterAtPoint"; frozen
# ---------- code_block_polycurve.designscript (12 lines) ----------
//create polycurve by points
//not closed
pl=PolyCurve.ByPoints(pts,false);

//get parameter at point
pa=PolyCurve.ParameterAtPoint(pl,pts);

//get the plane at the point
plane=PolyCurve.PlaneAtParameter(pl,pa);

//get cooridnate system of the plane
co=Plane.ToCoordinateSystem(plane);
# ----------------------------------------

# group: Testing
boolean = BoolSelector(false)
byPoints = PolyCurve.ByPoints(points=pruneDuplicates, connectLastToFirst=boolean)
parameterAtPoint = Curve.ParameterAtPoint(curve=byPoints, point=pruneDuplicates)
planeAtParameter = Curve.PlaneAtParameter(curve=byPoints, param=parameterAtPoint)
toCoordinateSystem = Plane.ToCoordinateSystem(plane=planeAtParameter)
