# Dynamo graph ElementBindingLarge.dyn (Dynamo 2.0.2.8095)

code_block = CodeBlock { 0..1500; }
wrapperObject = FFITarget.WrapperObject.WrapperObject(x=code_block)
ID = FFITarget.WrapperObject.ID(wrapperObject=wrapperObject)
