# Dynamo graph ElipseCurves.dyn (Dynamo 2.2.1.5175)

# note: Variables / Inputs
# Green indicates Variables that can be altered per project and must be set accordingly before running the script.
# note: Working / Functions
# Orange indicates the working of the script. No changes should be made in these groups unless advised.
# note: Checking / Outputs
# Red indicates checking nodes to ensure the script has deployed correctly.

# group: 13.3.1 Ellipse workflow (Dynamo Geometry):
# note: DYNAMO VERSION
# 2.4.0
# note: REQUIRED DYNAMO PACKAGES
# Dynamik
# Ampersand
# note: ADDITIONAL COMMENTS
# note: DYNAMO PROJECT
# Dynamo Profiling
# note: ASSOCIATED FILE(S)
# note: AUTHOR(S) / CREATION DATE
# metaspace for Autodesk Dynamo Team / Septembe 2019
# note: DESCRIPTION
# Research script of different geometrical methods for ellipse creation. The workflow is split into two different script, one that creates ellipses and turn them into Revit model lines and one that takes those model lines and make solids out of them. Both scripts have a high number of nodes and do a lot of geometry creation, it was necessary to split the workflow up otherwise Dynamo would crash.

# group: OUTER BOUNDARY
XTRANSLATION = IntegerSlider(50075, range=75..100000 step 5000)  # graph input
YTRANSLATION = IntegerSlider(30000, range=0..100000 step 5000)  # graph input
YAxis_BigEllipse = IntegerSlider(38000, range=10000..60000 step 1000)  # graph input
YAxis_SmallEllipse = IntegerSlider(29040, range=40..60000 step 1000)  # graph input
rotation1 = IntegerSlider(5, range=-180..180 step 1)  # graph input
rotation2 = IntegerSlider(15, range=-180..180 step 5)  # graph input
top_radius = IntegerSlider(15000, range=1000..60000 step 1000)
bottom_radius = IntegerSlider(14000, range=1000..30000 step 1000)

# group: ELLIPSE CENTERS
center_1 = Point.ByCoordinates()
center_2 = Geometry.Translate(geometry=center_1, xTranslation=XTRANSLATION, yTranslation=YTRANSLATION)

ZAxis = Vector.ZAxis()

# group: Elipse
code_block = CodeBlock(originCenter1=center_1, originCenter2=center_2) { originCenter1; originCenter2; [originCenter1,originCenter2]; }
code_block_2 = CodeBlock(y_BigEllipse=YAxis_BigEllipse, y_SmallEllipse=YAxis_SmallEllipse) { y_BigEllipse; y_SmallEllipse; [y_BigEllipse,y_SmallEllipse]; }
byOriginRadii = Ellipse.ByOriginRadii(origin=code_block.out2, yAxisRadius=code_block_2.out2)
code_block_3 = CodeBlock(rotation1=rotation1, rotation2=rotation2) { rotation1; rotation2; [rotation1,rotation2]; }
rotate = Geometry.Rotate(geometry=byOriginRadii, origin=code_block.out2, axis=ZAxis, degrees=code_block_3.out2)

ellipseToOval_SerlioII = Custom[EllipseToOval_SerlioII](centralpoint=code_block.out2, ellipse=rotate)
byJoinedCurves = PolyCurve.ByJoinedCurves(curves=ellipseToOval_SerlioII)
code_block_4 = CodeBlock(a=top_radius) { a; }
code_block_5 = CodeBlock(b=bottom_radius) { b; }
list_create = List.Create(item0=code_block_4, item1=code_block_5)
offset = Curve.Offset(curve=byJoinedCurves, distance=list_create, lacing=CrossProduct)
code_block_6 = CodeBlock(x=offset) { x[0]; x[1]; }
intersect = Geometry.Intersect(geometry=code_block_6.out0, other=code_block_6.out1)
code_block_7 = CodeBlock(x=intersect) { x[0]; x[1]; }
lastItem = List.LastItem(list=code_block_7.out0)
firstItem = List.FirstItem(list=code_block_7.out1)
list_create_2 = List.Create(item0=lastItem, item1=firstItem)
byCenterPointRadius = Circle.ByCenterPointRadius(centerPoint=list_create_2, radius=list_create)
code_block_8 = CodeBlock(circ=byCenterPointRadius) { circ[0]; circ[1]; }
intersect_2 = Geometry.Intersect(geometry=code_block_8.out0, other=byJoinedCurves)
flatten = List.Flatten(list=intersect_2)
intersect_3 = Geometry.Intersect(geometry=code_block_8.out1, other=byJoinedCurves)
flatten_2 = List.Flatten(list=intersect_3)
code_block_9 = CodeBlock(x=flatten, y=flatten_2) { startpoints = [x[0],y[1]]; endPoints = [x[1],y[0]]; }
byCenterPointStartPointEndPoint = Arc.ByCenterPointStartPointEndPoint(centerPoint=list_create_2, startPoint=code_block_9.startpoints, endPoint=code_block_9.endPoints)
doesIntersect = Geometry.DoesIntersect(geometry=ellipseToOval_SerlioII@@L1, other=byCenterPointStartPointEndPoint@L1, lacing=CrossProduct)
allFalse = List.AllFalse(list=doesIntersect@@L2, lacing=Longest)
filterByBoolMask = List.FilterByBoolMask(list=ellipseToOval_SerlioII@L2, mask=allFalse@L2, lacing=Longest)
firstItem_2 = List.FirstItem(list=filterByBoolMask.in@L2)
code_block_10 = CodeBlock(x=firstItem_2) { x[0]; x[1]; }
color_palette = ColorPalette({R: 255, G: 140, B: 0, A: 255})
byGeometryColor = Modifiers.GeometryColor.ByGeometryColor(geometry=code_block_10.out0, color=color_palette)
code_block_11 = CodeBlock(l=byCenterPointStartPointEndPoint) { l[0]; l[1]; }
color_palette_2 = ColorPalette({R: 218, G: 112, B: 214, A: 255})
byGeometryColor_2 = Modifiers.GeometryColor.ByGeometryColor(geometry=code_block_11.out1, color=color_palette_2)
lastItem_2 = List.LastItem(list=filterByBoolMask.in@L2)
code_block_12 = CodeBlock(x=lastItem_2) { x[0]; x[1]; }
color_palette_3 = ColorPalette({R: 238, G: 232, B: 170, A: 255})
byGeometryColor_3 = Modifiers.GeometryColor.ByGeometryColor(geometry=code_block_12.out1, color=color_palette_3)
color_palette_4 = ColorPalette({R: 46, G: 139, B: 87, A: 255})
byGeometryColor_4 = Modifiers.GeometryColor.ByGeometryColor(geometry=code_block_10.out1, color=color_palette_4)
code_block_13 = CodeBlock(x=ellipseToOval_SerlioII) { x[0]; x[1]; }
doesIntersect_2 = Geometry.DoesIntersect(geometry=ellipseToOval_SerlioII, other=byCenterPointStartPointEndPoint, lacing=CrossProduct)
code_block_14 = CodeBlock(x=doesIntersect_2) { x[0]; x[1]; }
filterByBoolMask_2 = List.FilterByBoolMask(list=code_block_13.out0, mask=code_block_14.out0@L2)
filterByBoolMask_3 = List.FilterByBoolMask(list=code_block_13.out1, mask=code_block_14.out1@L2)
list_create_3 = List.Create(item0=filterByBoolMask_2.in, item1=filterByBoolMask_3.in)
flatten_3 = List.Flatten(list=list_create_3@L3)
intersect_4 = Geometry.Intersect(geometry=flatten_3@L2, other=byCenterPointStartPointEndPoint@L2, lacing=Longest)
flatten_4 = List.Flatten(list=intersect_4@L3)
splitByPoints = Curve.SplitByPoints(curve=flatten_3@L1, points=flatten_4@@L1)
code_block_15 = CodeBlock(x=splitByPoints) { x[0]; x[1]; }
code_block_16 = CodeBlock { 1; }
getItemAtIndex = List.GetItemAtIndex(list=code_block_15.out1, index=code_block_16, lacing=CrossProduct)
code_block_17 = CodeBlock(y=getItemAtIndex) { y[0]; y[1]; }
byGeometryColor_5 = Modifiers.GeometryColor.ByGeometryColor(geometry=code_block_17.out1, color=color_palette_4)
code_block_18 = CodeBlock { 0; }
getItemAtIndex_2 = List.GetItemAtIndex(list=code_block_15.out0, index=code_block_18, lacing=CrossProduct)
code_block_19 = CodeBlock(x=getItemAtIndex_2) { x[0]; x[1]; }
byGeometryColor_6 = Modifiers.GeometryColor.ByGeometryColor(geometry=code_block_19.out0, color=color_palette)
color_palette_5 = ColorPalette({R: 119, G: 136, B: 153, A: 255})
byGeometryColor_7 = Modifiers.GeometryColor.ByGeometryColor(geometry=code_block_11.out0, color=color_palette_5)
byGeometryColor_8 = Modifiers.GeometryColor.ByGeometryColor(geometry=code_block_17.out0, color=color_palette_3)
color_palette_6 = ColorPalette({R: 0, G: 255, B: 255, A: 255})
byGeometryColor_9 = Modifiers.GeometryColor.ByGeometryColor(geometry=code_block_19.out1, color=color_palette_6)
byGeometryColor_10 = Modifiers.GeometryColor.ByGeometryColor(geometry=code_block_12.out0, color=color_palette_6)
join = List.Join(list0=code_block_10.out1, list1=code_block_17.out0, list2=code_block_17.out1, list3=code_block_19.out0, list4=code_block_19.out1, list5=code_block_10.out0, list6=byCenterPointStartPointEndPoint, list7=code_block_12.out0, list8=code_block_12.out1)
flatten_5 = List.Flatten(list=join)
byJoinedCurves_2 = PolyCurve.ByJoinedCurves(curves=flatten_5)

# group: COMMON INPUTS
retail_h = DoubleSlider(6000, range=1000..10000 step 1000)
nOfficesLevels = IntegerSlider(7, range=1..10 step 1)
office_h = DoubleSlider(7000, range=1000..10000 step 1000)

code_block_20 = CodeBlock(retailH=retail_h) { 0..#3..retailH; }
lastItem_3 = List.LastItem(list=code_block_20)
code_block_21 = CodeBlock(r=lastItem_3, nofoffices=nOfficesLevels, officeH=office_h) { r..#nofoffices..officeH; }
code_block_22 = CodeBlock { 1; }
dropItems = List.DropItems(list=code_block_21, amount=code_block_22)
join_2 = List.Join(list0=code_block_20, list1=dropItems)
translate = Geometry.Translate(geometry=byJoinedCurves_2, zTranslation=join_2)

# group: INNER BOUNDARY
ellipse1_position = DoubleSlider(10000, range=0..20000 step 1000)
XTRANSLATION_2 = IntegerSlider(60075, range=75..100000 step 5000)  # graph input
YTRANSLATION_2 = IntegerSlider(25000, range=0..100000 step 5000)  # graph input
YAxis_BigEllipse_2 = IntegerSlider(21000, range=10000..60000 step 1000)  # graph input
YAxis_SmallEllipse_2 = IntegerSlider(10040, range=40..60000 step 1000)  # graph input
rotation1_2 = IntegerSlider(-2, range=-180..180 step 1)  # graph input
rotation2_2 = IntegerSlider(-5, range=-180..180 step 5)  # graph input
top_radius_2 = IntegerSlider(30000, range=1000..60000 step 1000)
bottom_radius_2 = IntegerSlider(23000, range=1000..50000 step 1000)

# group: ELLIPSE CENTERS
byCoordinates = Point.ByCoordinates(x=ellipse1_position)
code_block_23 = CodeBlock(x=XTRANSLATION_2, n=ellipse1_position) { x-n; }
center_2_2 = Geometry.Translate(geometry=byCoordinates, xTranslation=code_block_23, yTranslation=YTRANSLATION_2)

# group: Elipse
code_block_24 = CodeBlock(originCenter1=byCoordinates, originCenter2=center_2_2) { originCenter1; originCenter2; [originCenter1,originCenter2]; }
code_block_25 = CodeBlock(y_BigEllipse=YAxis_BigEllipse_2, y_SmallEllipse=YAxis_SmallEllipse_2) { y_BigEllipse; y_SmallEllipse; [y_BigEllipse,y_SmallEllipse]; }
byOriginRadii_2 = Ellipse.ByOriginRadii(origin=code_block_24.out2, yAxisRadius=code_block_25.out2)
code_block_26 = CodeBlock(rotation1=rotation1_2, rotation2=rotation2_2) { rotation1; rotation2; [rotation1,rotation2]; }
rotate_2 = Geometry.Rotate(geometry=byOriginRadii_2, origin=code_block_24.out2, axis=ZAxis, degrees=code_block_26.out2)

ellipseToOval_SerlioII_2 = Custom[EllipseToOval_SerlioII](centralpoint=code_block_24.out2, ellipse=rotate_2)
byJoinedCurves_3 = PolyCurve.ByJoinedCurves(curves=ellipseToOval_SerlioII_2)
code_block_27 = CodeBlock(a=top_radius_2) { a; }
code_block_28 = CodeBlock(b=bottom_radius_2) { b; }
list_create_4 = List.Create(item0=code_block_27, item1=code_block_28)
offset_2 = Curve.Offset(curve=byJoinedCurves_3, distance=list_create_4, lacing=CrossProduct)
code_block_29 = CodeBlock(x=offset_2) { x[0]; x[1]; }
intersect_5 = Geometry.Intersect(geometry=code_block_29.out0, other=code_block_29.out1)
code_block_30 = CodeBlock(x=intersect_5) { x[0]; x[1]; }
lastItem_4 = List.LastItem(list=code_block_30.out0)
firstItem_3 = List.FirstItem(list=code_block_30.out1)
list_create_5 = List.Create(item0=lastItem_4, item1=firstItem_3)
byCenterPointRadius_2 = Circle.ByCenterPointRadius(centerPoint=list_create_5, radius=list_create_4)
code_block_31 = CodeBlock(circ=byCenterPointRadius_2) { circ[0]; circ[1]; }
intersect_6 = Geometry.Intersect(geometry=code_block_31.out0, other=byJoinedCurves_3)
flatten_6 = List.Flatten(list=intersect_6)
intersect_7 = Geometry.Intersect(geometry=code_block_31.out1, other=byJoinedCurves_3)
flatten_7 = List.Flatten(list=intersect_7)
code_block_32 = CodeBlock(x=flatten_6, y=flatten_7) { startpoints = [x[0],y[1]]; endPoints = [x[1],y[0]]; }
byCenterPointStartPointEndPoint_2 = Arc.ByCenterPointStartPointEndPoint(centerPoint=list_create_5, startPoint=code_block_32.startpoints, endPoint=code_block_32.endPoints)
doesIntersect_3 = Geometry.DoesIntersect(geometry=ellipseToOval_SerlioII_2@@L1, other=byCenterPointStartPointEndPoint_2@L1, lacing=CrossProduct)
allFalse_2 = List.AllFalse(list=doesIntersect_3@@L2, lacing=Longest)
filterByBoolMask_4 = List.FilterByBoolMask(list=ellipseToOval_SerlioII_2@L2, mask=allFalse_2@L2, lacing=Longest)
firstItem_4 = List.FirstItem(list=filterByBoolMask_4.in@L2)
code_block_33 = CodeBlock(x=firstItem_4) { x[0]; x[1]; }
lastItem_5 = List.LastItem(list=filterByBoolMask_4.in@L2)
code_block_34 = CodeBlock(x=lastItem_5) { x[0]; x[1]; }
code_block_35 = CodeBlock(x=ellipseToOval_SerlioII_2) { x[0]; x[1]; }
doesIntersect_4 = Geometry.DoesIntersect(geometry=ellipseToOval_SerlioII_2, other=byCenterPointStartPointEndPoint_2, lacing=CrossProduct)
code_block_36 = CodeBlock(x=doesIntersect_4) { x[0]; x[1]; }
filterByBoolMask_5 = List.FilterByBoolMask(list=code_block_35.out0, mask=code_block_36.out0@L2)
filterByBoolMask_6 = List.FilterByBoolMask(list=code_block_35.out1, mask=code_block_36.out1@L2)
list_create_6 = List.Create(item0=filterByBoolMask_5.in, item1=filterByBoolMask_6.in)
flatten_8 = List.Flatten(list=list_create_6@L3)
intersect_8 = Geometry.Intersect(geometry=flatten_8@L2, other=byCenterPointStartPointEndPoint_2@L2, lacing=Longest)
flatten_9 = List.Flatten(list=intersect_8@L3)
splitByPoints_2 = Curve.SplitByPoints(curve=flatten_8@L1, points=flatten_9@@L1)
code_block_37 = CodeBlock(x=splitByPoints_2) { x[0]; x[1]; }
code_block_38 = CodeBlock { 1; }
getItemAtIndex_3 = List.GetItemAtIndex(list=code_block_37.out1, index=code_block_38, lacing=CrossProduct)
code_block_39 = CodeBlock(y=getItemAtIndex_3) { y[0]; y[1]; }
code_block_40 = CodeBlock { 0; }
getItemAtIndex_4 = List.GetItemAtIndex(list=code_block_37.out0, index=code_block_40, lacing=CrossProduct)
code_block_41 = CodeBlock(x=getItemAtIndex_4) { x[0]; x[1]; }
join_3 = List.Join(list0=code_block_33.out1, list1=code_block_34.out1, list2=code_block_39.out0, list3=code_block_39.out1, list4=code_block_41.out0, list5=code_block_41.out1, list6=code_block_33.out0, list7=code_block_34.out0, list8=byCenterPointStartPointEndPoint_2)
flatten_10 = List.Flatten(list=join_3)
byJoinedCurves_4 = PolyCurve.ByJoinedCurves(curves=flatten_10)
code_block_42 = CodeBlock(retailH=retail_h) { 0..#3..retailH; }
lastItem_6 = List.LastItem(list=code_block_42)
code_block_43 = CodeBlock(r=lastItem_6, nofoffices=nOfficesLevels, officeH=office_h) { r..#nofoffices..officeH; }
code_block_44 = CodeBlock { 1; }
dropItems_2 = List.DropItems(list=code_block_43, amount=code_block_44)
join_4 = List.Join(list0=code_block_42, list1=dropItems_2)
translate_2 = Geometry.Translate(geometry=byJoinedCurves_4, zTranslation=join_4)
code_block_45 = CodeBlock(l=byCenterPointStartPointEndPoint_2) { l[1]; }
color_palette_7 = ColorPalette({R: 34, G: 139, B: 34, A: 255})
byGeometryColor_11 = Modifiers.GeometryColor.ByGeometryColor(geometry=code_block_45, color=color_palette_7)
color_palette_8 = ColorPalette({R: 255, G: 196, B: 0, A: 255})
byGeometryColor_12 = Modifiers.GeometryColor.ByGeometryColor(geometry=code_block_41.out0, color=color_palette_8)
code_block_46 = CodeBlock(l=byCenterPointStartPointEndPoint_2) { l[0]; }
color_palette_9 = ColorPalette({R: 255, G: 99, B: 71, A: 255})
byGeometryColor_13 = Modifiers.GeometryColor.ByGeometryColor(geometry=code_block_46, color=color_palette_9)
byGeometryColor_14 = Modifiers.GeometryColor.ByGeometryColor(geometry=code_block_33.out0, color=color_palette_8)
color_palette_10 = ColorPalette({R: 184, G: 134, B: 11, A: 255})
byGeometryColor_15 = Modifiers.GeometryColor.ByGeometryColor(geometry=code_block_41.out1, color=color_palette_10)
byGeometryColor_16 = Modifiers.GeometryColor.ByGeometryColor(geometry=code_block_34.out0, color=color_palette_10)
color_palette_11 = ColorPalette({R: 0, G: 0, B: 255, A: 255})
byGeometryColor_17 = Modifiers.GeometryColor.ByGeometryColor(geometry=code_block_33.out1, color=color_palette_11)
byGeometryColor_18 = Modifiers.GeometryColor.ByGeometryColor(geometry=code_block_39.out1, color=color_palette_11)
color_palette_12 = ColorPalette({R: 0, G: 250, B: 154, A: 255})
byGeometryColor_19 = Modifiers.GeometryColor.ByGeometryColor(geometry=code_block_34.out1, color=color_palette_12)
byGeometryColor_20 = Modifiers.GeometryColor.ByGeometryColor(geometry=code_block_39.out0, color=color_palette_12)
byJoinedCurves_5 = PolyCurve.ByJoinedCurves(curves=ellipseToOval_SerlioII)
offset_3 = Curve.Offset(curve=byJoinedCurves_5, distance=list_create, lacing=CrossProduct)
code_block_47 = CodeBlock(x=offset_3) { x[0]; x[1]; }
intersect_9 = Geometry.Intersect(geometry=code_block_47.out0, other=code_block_47.out1)
code_block_48 = CodeBlock(x=intersect_9) { x[0]; x[1]; }
lastItem_7 = List.LastItem(list=code_block_48.out0)
firstItem_5 = List.FirstItem(list=code_block_48.out1)
list_create_7 = List.Create(item0=lastItem_7, item1=firstItem_5)
byCenterPointRadius_3 = Circle.ByCenterPointRadius(centerPoint=list_create_7, radius=list_create)
code_block_49 = CodeBlock(circ=byCenterPointRadius_3) { circ[0]; circ[1]; }
intersect_10 = Geometry.Intersect(geometry=code_block_49.out0, other=byJoinedCurves_5)
offset_4 = Curve.Offset(curve=byJoinedCurves_5, distance=code_block_5)
intersect_11 = Geometry.Intersect(geometry=code_block_49.out1, other=byJoinedCurves_5)
offset_5 = Curve.Offset(curve=byJoinedCurves_3)
byJoinedCurves_6 = PolyCurve.ByJoinedCurves(curves=ellipseToOval_SerlioII_2)
offset_6 = Curve.Offset(curve=byJoinedCurves_6, distance=list_create_4, lacing=CrossProduct)
code_block_50 = CodeBlock(x=offset_6) { x[0]; x[1]; }
intersect_12 = Geometry.Intersect(geometry=code_block_50.out0, other=code_block_50.out1)
code_block_51 = CodeBlock(x=intersect_12) { x[0]; x[1]; }
lastItem_8 = List.LastItem(list=code_block_51.out0)
firstItem_6 = List.FirstItem(list=code_block_51.out1)
list_create_8 = List.Create(item0=lastItem_8, item1=firstItem_6)
byCenterPointRadius_4 = Circle.ByCenterPointRadius(centerPoint=list_create_8, radius=list_create_4)
code_block_52 = CodeBlock(circ=byCenterPointRadius_4) { circ[0]; circ[1]; }
intersect_13 = Geometry.Intersect(geometry=code_block_52.out0, other=byJoinedCurves_6)
intersect_14 = Geometry.Intersect(geometry=code_block_52.out1, other=byJoinedCurves_6)
