# Dynamo graph GeometryDisposeLarge.dyn (Dynamo 2.5.0.6165)

code_block = CodeBlock { 100000; }
python_script = Python(IN[0]=code_block)
# ---------- python_script.python (19 lines) ----------
# Load the Python Standard and DesignScript Libraries
import sys
import clr
clr.AddReference('ProtoGeometry')
from Autodesk.DesignScript.Geometry import *

# The inputs to this node will be stored as a list in the IN variables.
size = IN[0]
out = []
# Place your code below this line

for i in range(size):
	Cuboid.ByLengths(1,1,1);
	
for i in range(size/10):
	out.append(Cuboid.ByLengths(1,1,1));
	
# Assign your output to the OUT variable.
OUT = out
# ----------------------------------------
