# Dynamo graph HeterogeneousInputsFirst.dyn (Dynamo 2.0.2.8095)

code_block = CodeBlock { 0..15; }
code_block_2 = CodeBlock { 0; 0.5; }
replaceItemAtIndex = List.ReplaceItemAtIndex(list=code_block, index=code_block_2.out0, item=code_block_2.out1)
code_block_3 = CodeBlock { 15; 15; }
replaceItemAtIndex_2 = List.ReplaceItemAtIndex(list=replaceItemAtIndex, index=code_block_3.out0, item=code_block_3.out1)
byCoordinates = Point.ByCoordinates(x=replaceItemAtIndex_2, y=replaceItemAtIndex_2, z=replaceItemAtIndex_2, lacing=CrossProduct)
