# Dynamo graph LotsOfColoredStuff.dyn (Dynamo 2.0.2.8095)

code_block = CodeBlock { 0..10..2; }
byCoordinates = Point.ByCoordinates(x=code_block, y=code_block, z=code_block, lacing=CrossProduct)
number_slider = DoubleSlider(0.7, range=0..1 step 0.05)  # graph input
byCenterPointRadius = Circle.ByCenterPointRadius(centerPoint=byCoordinates, radius=number_slider)
number_slider_2 = DoubleSlider(75, range=0..255 step 25)  # graph input
byARGB = Color.ByARGB(r=number_slider_2)
byGeometryColor = Modifiers.GeometryColor.ByGeometryColor(geometry=byCenterPointRadius, color=byARGB)
byCenterPointRadius_2 = Sphere.ByCenterPointRadius(centerPoint=byCoordinates, radius=number_slider)
number_slider_3 = DoubleSlider(255, range=0..255 step 25)  # graph input
byARGB_2 = Color.ByARGB(g=number_slider_3, b=number_slider_2)
byGeometryColor_2 = Modifiers.GeometryColor.ByGeometryColor(geometry=byCenterPointRadius_2, color=byARGB_2)
byLengths = Cuboid.ByLengths(origin=byCoordinates)
number_slider_4 = DoubleSlider(255, range=0..255 step 25)  # graph input
byARGB_3 = Color.ByARGB(r=number_slider_3, b=number_slider_4)
byGeometryColor_3 = Modifiers.GeometryColor.ByGeometryColor(geometry=byLengths, color=byARGB_3)
edges = Topology.Edges(topology=byLengths)
curveGeometry = Edge.CurveGeometry(edge=edges)
byARGB_4 = Color.ByARGB(r=number_slider_4, g=number_slider_3)
byGeometryColor_4 = Modifiers.GeometryColor.ByGeometryColor(geometry=curveGeometry, color=byARGB_4)
