# Dynamo graph LotsOfStuff.dyn (Dynamo 2.3.0.4415)

code_block = CodeBlock { 0..20..2; }
byCoordinates = Point.ByCoordinates(x=code_block, y=code_block, z=code_block, lacing=CrossProduct)
number_slider = DoubleSlider(0.7, range=0..1 step 0.05)  # graph input
byCenterPointRadius = Sphere.ByCenterPointRadius(centerPoint=byCoordinates, radius=number_slider)
byLengths = Cuboid.ByLengths(origin=byCoordinates)
edges = Topology.Edges(topology=byLengths)
curveGeometry = Edge.CurveGeometry(edge=edges)
number = DoubleInput(0.6)  # graph input
byCenterPointRadius_2 = Circle.ByCenterPointRadius(centerPoint=byCoordinates, radius=number_slider)
