# Dynamo graph Performance-Test.dyn (Dynamo 2.15.2.6417)
# author: Michael Günther-Geffer (GG)
# This script creates the skeleton of a human body. All important joints are placed and oriented relative to their predecessor. The starting coordinate system for this is the hip center point. For the body parts, .tss files are imported from disk, and then transformed, according to the created skeleton. “© 2023 Autodesk, Inc. All rights reserved.“

height = IntegerSlider(1800, range=400..2300 step 10)  # graph input

# group: Relative Chest Depth
code_block = CodeBlock { 0.15; }
mul = height * code_block

# group: Relative Hip Depth
code_block_2 = CodeBlock { 0.11; }
mul_2 = height * code_block_2

byCoordinates = Point.ByCoordinates()

# group: Relative Hip Position Z value
code_block_3 = CodeBlock { 0.53; }
mul_3 = height * code_block_3

byCoordinates_2 = Point.ByCoordinates(z=mul_3)

# group: If given, take user defined point for Hip placement, otherwise take default
list_create = List.Create(item0=byCoordinates, item1=byCoordinates_2)
code_block_4 = CodeBlock { false; }
clean = List.Clean(list=list_create, preserveIndices=code_block_4)
firstItem = List.FirstItem(list=clean)

# group: Hip Center Point
byOrigin = CoordinateSystem.ByOrigin(origin=firstItem)

# group: Body
z_rotation = IntegerSlider(0, range=-180..180 step 1)  # graph input
y_rotation = IntegerSlider(0, range=-90..90 step 1)  # graph input
x_rotation = IntegerSlider(0, range=-180..180 step 1)  # graph input

# group: Hip Rotation around Z Axis
origin = CoordinateSystem.Origin(coordinateSystem=byOrigin)
ZAxis = Vector.ZAxis()
rotate = CoordinateSystem.Rotate(coordinateSystem=byOrigin, origin=origin, axis=ZAxis, degrees=z_rotation)

# group: Relative Torso Length
code_block_5 = CodeBlock { 0.29; }
mul_4 = height * code_block_5

byCartesianCoordinates = Point.ByCartesianCoordinates(coordinateSystem=rotate, z=mul_4)
byCenterPointRadius = Sphere.ByCenterPointRadius(centerPoint=byCartesianCoordinates)

# group: Hip Rotation around (possible new, because already rotated) Y axis
code_block_6 = CodeBlock { 1; }
byCartesianCoordinates_2 = Point.ByCartesianCoordinates(coordinateSystem=rotate, y=code_block_6)
byTwoPoints = Vector.ByTwoPoints(start=origin, end=byCartesianCoordinates_2)
rotate_2 = CoordinateSystem.Rotate(coordinateSystem=rotate, origin=origin, axis=byTwoPoints, degrees=y_rotation)

# group: Hip Rotation around (possibly new) X axis - Final Hip Coordinate System
code_block_7 = CodeBlock { 1; }
byCartesianCoordinates_3 = Point.ByCartesianCoordinates(coordinateSystem=rotate_2, x=code_block_7)
byTwoPoints_2 = Vector.ByTwoPoints(start=origin, end=byCartesianCoordinates_3)
rotate_3 = CoordinateSystem.Rotate(coordinateSystem=rotate_2, origin=origin, axis=byTwoPoints_2, degrees=x_rotation)
origin_2 = CoordinateSystem.Origin(coordinateSystem=rotate_3)

# group: Shoulder Backward Lean
code_block_8 = CodeBlock { 0.02; }
mul_5 = height * code_block_8

# group: Shoulder
z_rotation_2 = IntegerSlider(0, range=-120..120 step 1)

# group: Center Shoulder Joint
byCartesianCoordinates_4 = Point.ByCartesianCoordinates(coordinateSystem=rotate_3, x=mul_5, z=mul_4)
byTwoPoints_3 = Vector.ByTwoPoints(start=origin_2, end=byCartesianCoordinates_4)
translate = CoordinateSystem.Translate(coordinateSystem=rotate_3, direction=byTwoPoints_3)
origin_3 = CoordinateSystem.Origin(coordinateSystem=translate)
code_block_9 = CodeBlock { 1; }
byCartesianCoordinates_5 = Point.ByCartesianCoordinates(coordinateSystem=translate, z=code_block_9)
byTwoPoints_4 = Vector.ByTwoPoints(start=origin_3, end=byCartesianCoordinates_5)
z_coordinatesystem_rotate = CoordinateSystem.Rotate(coordinateSystem=translate, origin=origin_3, axis=byTwoPoints_4, degrees=z_rotation_2)
origin_4 = CoordinateSystem.Origin(coordinateSystem=z_coordinatesystem_rotate)

# group: Relative Shoulder Width Y Value
code_block_10 = CodeBlock { 0.20; }
mul_6 = height * code_block_10

# group: Right Shoulder Joint
code_block_11 = CodeBlock { 0.5; }
mul_7 = mul_6 * code_block_11
byCartesianCoordinates_6 = Point.ByCartesianCoordinates(coordinateSystem=z_coordinatesystem_rotate, y=mul_7)
byTwoPoints_5 = Vector.ByTwoPoints(start=origin_3, end=byCartesianCoordinates_6)
translate_2 = CoordinateSystem.Translate(coordinateSystem=z_coordinatesystem_rotate, direction=byTwoPoints_5)
origin_5 = CoordinateSystem.Origin(coordinateSystem=translate_2)

# group: Right Upper Arm
y_rotation_2 = IntegerSlider(0, range=-90..180 step 1)  # graph input
x_rotation_2 = IntegerSlider(0, range=0..110 step 1)  # graph input
z_rotation_3 = IntegerSlider(0, range=-90..90 step 1)  # graph input

# group: Right Upper Arm Rotation around Y Axis
code_block_12 = CodeBlock { 1; }
byCartesianCoordinates_7 = Point.ByCartesianCoordinates(coordinateSystem=translate_2, y=code_block_12)
byTwoPoints_6 = Vector.ByTwoPoints(start=origin_5, end=byCartesianCoordinates_7)
rotate_4 = CoordinateSystem.Rotate(coordinateSystem=translate_2, origin=origin_5, axis=byTwoPoints_6, degrees=y_rotation_2)
origin_6 = CoordinateSystem.Origin(coordinateSystem=rotate_4)

# group: Right Upper Arm Rotation around (possible new, because already rotated) X axis
code_block_13 = CodeBlock { 1; }
byCartesianCoordinates_8 = Point.ByCartesianCoordinates(coordinateSystem=rotate_4, x=code_block_13)
byTwoPoints_7 = Vector.ByTwoPoints(start=origin_6, end=byCartesianCoordinates_8)
rotate_5 = CoordinateSystem.Rotate(coordinateSystem=rotate_4, origin=origin_6, axis=byTwoPoints_7, degrees=x_rotation_2)
origin_7 = CoordinateSystem.Origin(coordinateSystem=rotate_5)

# group: Right Upper Arm Rotation around (possibly new) Z axis - Final Right Shoulder Joint Coordinate System
code_block_14 = CodeBlock { 1; }
byCartesianCoordinates_9 = Point.ByCartesianCoordinates(coordinateSystem=rotate_5, z=code_block_14)
byTwoPoints_8 = Vector.ByTwoPoints(start=origin_7, end=byCartesianCoordinates_9)
rotate_6 = CoordinateSystem.Rotate(coordinateSystem=rotate_5, origin=origin_7, axis=byTwoPoints_8, degrees=z_rotation_3)
origin_8 = CoordinateSystem.Origin(coordinateSystem=rotate_6)

# group: Remove Shoulder Backward Lean again
code_block_15 = CodeBlock { -1; }
mul_8 = mul_5 * code_block_15

# group: Relative Neck Length
code_block_16 = CodeBlock { 0.04; }
mul_9 = height * code_block_16

# group: Head Joint Initial
byCartesianCoordinates_10 = Point.ByCartesianCoordinates(coordinateSystem=z_coordinatesystem_rotate, x=mul_8, z=mul_9)
byTwoPoints_9 = Vector.ByTwoPoints(start=origin_4, end=byCartesianCoordinates_10)
translate_3 = CoordinateSystem.Translate(coordinateSystem=z_coordinatesystem_rotate, direction=byTwoPoints_9)
origin_9 = CoordinateSystem.Origin(coordinateSystem=translate_3)

# group: Head
z_rotation_4 = IntegerSlider(0, range=-100..100 step 1)  # graph input
y_rotation_3 = IntegerSlider(0, range=-70..70 step 1)  # graph input
x_rotation_3 = IntegerSlider(0, range=-45..45 step 1)  # graph input

# group: Head Rotation around Z Axis
code_block_17 = CodeBlock { 1; }
byCartesianCoordinates_11 = Point.ByCartesianCoordinates(coordinateSystem=translate_3, z=code_block_17)
byTwoPoints_10 = Vector.ByTwoPoints(start=origin_9, end=byCartesianCoordinates_11)
rotate_7 = CoordinateSystem.Rotate(coordinateSystem=translate_3, origin=origin_9, axis=byTwoPoints_10, degrees=z_rotation_4)
origin_10 = CoordinateSystem.Origin(coordinateSystem=rotate_7)

# group: Head Rotation around Y Axis
code_block_18 = CodeBlock { 1; }
byCartesianCoordinates_12 = Point.ByCartesianCoordinates(coordinateSystem=rotate_7, y=code_block_18)
byTwoPoints_11 = Vector.ByTwoPoints(start=origin_10, end=byCartesianCoordinates_12)
rotate_8 = CoordinateSystem.Rotate(coordinateSystem=rotate_7, origin=origin_10, axis=byTwoPoints_11, degrees=y_rotation_3)
origin_11 = CoordinateSystem.Origin(coordinateSystem=rotate_8)

# group: Head Rotation around X Axis - Final Head Coordinate System
code_block_19 = CodeBlock { 1; }
byCartesianCoordinates_13 = Point.ByCartesianCoordinates(coordinateSystem=rotate_8, x=code_block_19)
byTwoPoints_12 = Vector.ByTwoPoints(start=origin_11, end=byCartesianCoordinates_13)
rotate_9 = CoordinateSystem.Rotate(coordinateSystem=rotate_8, origin=origin_11, axis=byTwoPoints_12, degrees=x_rotation_3)
origin_12 = CoordinateSystem.Origin(coordinateSystem=rotate_9)

# group: Relative Hip Width Y Value
code_block_20 = CodeBlock { 0.1; }
mul_10 = height * code_block_20

# group: Relative Hip Joint positions
code_block_21 = CodeBlock { 0.5; }
mul_11 = mul_10 * code_block_21
code_block_22 = CodeBlock { -1; }
mul_12 = mul_11 * code_block_22

# group: Right Hip Joint
byCartesianCoordinates_14 = Point.ByCartesianCoordinates(coordinateSystem=rotate_3, y=mul_11)
byTwoPoints_13 = Vector.ByTwoPoints(start=origin_2, end=byCartesianCoordinates_14)
translate_4 = CoordinateSystem.Translate(coordinateSystem=rotate_3, direction=byTwoPoints_13)
origin_13 = CoordinateSystem.Origin(coordinateSystem=translate_4)

# group: Right Thigh
y_rotation_4 = IntegerSlider(0, range=-30..150 step 1)  # graph input
x_rotation_4 = IntegerSlider(0, range=-15..70 step 1)  # graph input
z_rotation_5 = IntegerSlider(0, range=-15..15 step 1)  # graph input
apply_to_other_side = ComboBoxNode("No", ItemList=[{Name: "Yes", Item: "0"}, {Name: "No", Item: "1"}], IsRadio=false)  # graph input

# group: Right Thigh Rotation around Y Axis
code_block_23 = CodeBlock { 1; }
byCartesianCoordinates_15 = Point.ByCartesianCoordinates(coordinateSystem=translate_4, y=code_block_23)
byTwoPoints_14 = Vector.ByTwoPoints(start=origin_13, end=byCartesianCoordinates_15)
rotate_10 = CoordinateSystem.Rotate(coordinateSystem=translate_4, origin=origin_13, axis=byTwoPoints_14, degrees=y_rotation_4)
origin_14 = CoordinateSystem.Origin(coordinateSystem=rotate_10)

# group: Right Thigh Rotation around (possible new, because already rotated) X axis
code_block_24 = CodeBlock { 1; }
byCartesianCoordinates_16 = Point.ByCartesianCoordinates(coordinateSystem=rotate_10, x=code_block_24)
byTwoPoints_15 = Vector.ByTwoPoints(start=origin_14, end=byCartesianCoordinates_16)
rotate_11 = CoordinateSystem.Rotate(coordinateSystem=rotate_10, origin=origin_14, axis=byTwoPoints_15, degrees=x_rotation_4)
origin_15 = CoordinateSystem.Origin(coordinateSystem=rotate_11)

# group: Right Thigh Rotation around (possibly new) Z axis - Final Right Hip Joint Coordinate System
code_block_25 = CodeBlock { 1; }
byCartesianCoordinates_17 = Point.ByCartesianCoordinates(coordinateSystem=rotate_11, z=code_block_25)
byTwoPoints_16 = Vector.ByTwoPoints(start=origin_15, end=byCartesianCoordinates_17)
rotate_12 = CoordinateSystem.Rotate(coordinateSystem=rotate_11, origin=origin_15, axis=byTwoPoints_16, degrees=z_rotation_5)
origin_16 = CoordinateSystem.Origin(coordinateSystem=rotate_12)

# group: Relative Thigh Length
code_block_26 = CodeBlock { 0.24; }
mul_13 = height * code_block_26

# group: Relative Knee positions
code_block_27 = CodeBlock { -1; }
mul_14 = mul_13 * code_block_27

# group: Right Shank
y_rotation_5 = IntegerSlider(0, range=-160..0 step 1)  # graph input
apply_to_other_side_2 = ComboBoxNode("No", ItemList=[{Name: "Yes", Item: "0"}, {Name: "No", Item: "1"}], IsRadio=false)  # graph input

# group: Right Knee Joint
byCartesianCoordinates_18 = Point.ByCartesianCoordinates(coordinateSystem=rotate_12, z=mul_14)
byTwoPoints_17 = Vector.ByTwoPoints(start=origin_16, end=byCartesianCoordinates_18)
translate_5 = CoordinateSystem.Translate(coordinateSystem=rotate_12, direction=byTwoPoints_17)
origin_17 = CoordinateSystem.Origin(coordinateSystem=translate_5)
code_block_28 = CodeBlock { 1; }
byCartesianCoordinates_19 = Point.ByCartesianCoordinates(coordinateSystem=translate_5, y=code_block_28)
byTwoPoints_18 = Vector.ByTwoPoints(start=origin_17, end=byCartesianCoordinates_19)
y_coordinatesystem_rotate = CoordinateSystem.Rotate(coordinateSystem=translate_5, origin=origin_17, axis=byTwoPoints_18, degrees=y_rotation_5)
origin_18 = CoordinateSystem.Origin(coordinateSystem=y_coordinatesystem_rotate)

# group: Relative Lower Leg Length
code_block_29 = CodeBlock { 0.24; }
mul_15 = height * code_block_29

# group: Relative Ankle positions
code_block_30 = CodeBlock { -1; }
mul_16 = mul_15 * code_block_30

# group: Right Foot
y_rotation_6 = IntegerSlider(0, range=-60..15 step 1)  # graph input
z_rotation_6 = IntegerSlider(0, range=-45..45 step 1)  # graph input
mirror = ComboBoxNode("No", ItemList=[{Name: "Yes", Item: "-1"}, {Name: "No", Item: "1"}], IsRadio=false)  # graph input
apply_to_other_side_3 = ComboBoxNode("No", ItemList=[{Name: "Yes", Item: "0"}, {Name: "No", Item: "1"}], IsRadio=false)  # graph input

# group: Right Ankle Joint
byCartesianCoordinates_20 = Point.ByCartesianCoordinates(coordinateSystem=y_coordinatesystem_rotate, z=mul_16)
byTwoPoints_19 = Vector.ByTwoPoints(start=origin_17, end=byCartesianCoordinates_20)
translate_6 = CoordinateSystem.Translate(coordinateSystem=y_coordinatesystem_rotate, direction=byTwoPoints_19)
origin_19 = CoordinateSystem.Origin(coordinateSystem=translate_6)
code_block_31 = CodeBlock { 1; }
byCartesianCoordinates_21 = Point.ByCartesianCoordinates(coordinateSystem=translate_6, y=code_block_31)
byTwoPoints_20 = Vector.ByTwoPoints(start=origin_19, end=byCartesianCoordinates_21)
y_coordinatesystem_rotate_2 = CoordinateSystem.Rotate(coordinateSystem=translate_6, origin=origin_19, axis=byTwoPoints_20, degrees=y_rotation_6)
code_block_32 = CodeBlock { 1; }
byCartesianCoordinates_22 = Point.ByCartesianCoordinates(coordinateSystem=y_coordinatesystem_rotate_2, z=code_block_32)
byTwoPoints_21 = Vector.ByTwoPoints(start=origin_19, end=byCartesianCoordinates_22)
z_coordinatesystem_rotate_2 = CoordinateSystem.Rotate(coordinateSystem=y_coordinatesystem_rotate_2, origin=origin_19, axis=byTwoPoints_21, degrees=z_rotation_6)
origin_20 = CoordinateSystem.Origin(coordinateSystem=z_coordinatesystem_rotate_2)

# group: Left Hip Joint
byCartesianCoordinates_23 = Point.ByCartesianCoordinates(coordinateSystem=rotate_3, y=mul_12)
byTwoPoints_22 = Vector.ByTwoPoints(start=origin_2, end=byCartesianCoordinates_23)
translate_7 = CoordinateSystem.Translate(coordinateSystem=rotate_3, direction=byTwoPoints_22)
origin_21 = CoordinateSystem.Origin(coordinateSystem=translate_7)

# group: Left Thigh
y_rotation_7 = IntegerSlider(0, range=-90..150 step 1)  # graph input
x_rotation_5 = IntegerSlider(0, range=-70..15 step 1)  # graph input
z_rotation_7 = IntegerSlider(0, range=-15..15 step 1)  # graph input

# group: Y: Use Right Side Values for Left Side, too?
list_create_2 = List.Create(item0=y_rotation_4, item1=y_rotation_7)
getItemAtIndex = List.GetItemAtIndex(list=list_create_2, index=apply_to_other_side)

# group: Left Thigh Rotation around Y Axis
code_block_33 = CodeBlock { 1; }
byCartesianCoordinates_24 = Point.ByCartesianCoordinates(coordinateSystem=translate_7, y=code_block_33)
byTwoPoints_23 = Vector.ByTwoPoints(start=origin_21, end=byCartesianCoordinates_24)
rotate_13 = CoordinateSystem.Rotate(coordinateSystem=translate_7, origin=origin_21, axis=byTwoPoints_23, degrees=getItemAtIndex)
origin_22 = CoordinateSystem.Origin(coordinateSystem=rotate_13)

# group: Invert X Value
# Invert the X value, because in case it shall be applied to the other side, the joint range of motion boundaries might be violated.
code_block_34 = CodeBlock { -1; }
mul_17 = x_rotation_4 * code_block_34

# group: X: Use Right Side Values for Left Side, too?
list_create_3 = List.Create(item0=mul_17, item1=x_rotation_5)
getItemAtIndex_2 = List.GetItemAtIndex(list=list_create_3, index=apply_to_other_side)

# group: Left Thigh Rotation around (possible new, because already rotated) X axis
code_block_35 = CodeBlock { 1; }
byCartesianCoordinates_25 = Point.ByCartesianCoordinates(coordinateSystem=rotate_13, x=code_block_35)
byTwoPoints_24 = Vector.ByTwoPoints(start=origin_22, end=byCartesianCoordinates_25)
rotate_14 = CoordinateSystem.Rotate(coordinateSystem=rotate_13, origin=origin_22, axis=byTwoPoints_24, degrees=getItemAtIndex_2)
origin_23 = CoordinateSystem.Origin(coordinateSystem=rotate_14)

# group: Invert Z Value
# To keet it simple, I think using the mirror value will be the most common use case. If the user can choose here, it makes the UI in Alias and the Dynamo graph more complicated
code_block_36 = CodeBlock { -1; }
mul_18 = z_rotation_5 * code_block_36

# group: Z: Use Right Side Values for Left Side, too?
list_create_4 = List.Create(item0=mul_18, item1=z_rotation_7)
getItemAtIndex_3 = List.GetItemAtIndex(list=list_create_4, index=apply_to_other_side)

# group: Left Thigh Rotation around (possibly new) Z axis - Final Left Hip Joint Coordinate System
code_block_37 = CodeBlock { 1; }
byCartesianCoordinates_26 = Point.ByCartesianCoordinates(coordinateSystem=rotate_14, z=code_block_37)
byTwoPoints_25 = Vector.ByTwoPoints(start=origin_23, end=byCartesianCoordinates_26)
rotate_15 = CoordinateSystem.Rotate(coordinateSystem=rotate_14, origin=origin_23, axis=byTwoPoints_25, degrees=getItemAtIndex_3)
origin_24 = CoordinateSystem.Origin(coordinateSystem=rotate_15)

# group: Left Shank
y_rotation_8 = IntegerSlider(0, range=-160..0 step 1)  # graph input

# group: Use Right Side Values for Left Side, too?
list_create_5 = List.Create(item0=y_rotation_5, item1=y_rotation_8)
getItemAtIndex_4 = List.GetItemAtIndex(list=list_create_5, index=apply_to_other_side_2)

# group: Left Knee Joint
byCartesianCoordinates_27 = Point.ByCartesianCoordinates(coordinateSystem=rotate_15, z=mul_14)
byTwoPoints_26 = Vector.ByTwoPoints(start=origin_24, end=byCartesianCoordinates_27)
translate_8 = CoordinateSystem.Translate(coordinateSystem=rotate_15, direction=byTwoPoints_26)
origin_25 = CoordinateSystem.Origin(coordinateSystem=translate_8)
code_block_38 = CodeBlock { 1; }
byCartesianCoordinates_28 = Point.ByCartesianCoordinates(coordinateSystem=translate_8, y=code_block_38)
byTwoPoints_27 = Vector.ByTwoPoints(start=origin_25, end=byCartesianCoordinates_28)
y_coordinatesystem_rotate_3 = CoordinateSystem.Rotate(coordinateSystem=translate_8, origin=origin_25, axis=byTwoPoints_27, degrees=getItemAtIndex_4)
origin_26 = CoordinateSystem.Origin(coordinateSystem=y_coordinatesystem_rotate_3)

mul_19 = z_rotation_6 * mirror

# group: Left Foot
y_rotation_9 = IntegerSlider(0, range=-60..15 step 1)  # graph input
z_rotation_8 = IntegerSlider(0, range=-45..45 step 1)  # graph input

# group: Use Right Side Values for Left Side, too?
list_create_6 = List.Create(item0=y_rotation_6, item1=mul_19)
list_create_7 = List.Create(item0=y_rotation_9, item1=z_rotation_8)
list_create_8 = List.Create(item0=list_create_6, item1=list_create_7)
getItemAtIndex_5 = List.GetItemAtIndex(list=list_create_8, index=apply_to_other_side_3)
firstItem_2 = List.FirstItem(list=getItemAtIndex_5)
lastItem = List.LastItem(list=getItemAtIndex_5)

# group: Left Ankle Joint
byCartesianCoordinates_29 = Point.ByCartesianCoordinates(coordinateSystem=y_coordinatesystem_rotate_3, z=mul_16)
byTwoPoints_28 = Vector.ByTwoPoints(start=origin_25, end=byCartesianCoordinates_29)
translate_9 = CoordinateSystem.Translate(coordinateSystem=y_coordinatesystem_rotate_3, direction=byTwoPoints_28)
origin_27 = CoordinateSystem.Origin(coordinateSystem=translate_9)
code_block_39 = CodeBlock { 1; }
byCartesianCoordinates_30 = Point.ByCartesianCoordinates(coordinateSystem=translate_9, y=code_block_39)
byTwoPoints_29 = Vector.ByTwoPoints(start=origin_27, end=byCartesianCoordinates_30)
y_coordinatesystem_rotate_4 = CoordinateSystem.Rotate(coordinateSystem=translate_9, origin=origin_27, axis=byTwoPoints_29, degrees=firstItem_2)
code_block_40 = CodeBlock { 1; }
byCartesianCoordinates_31 = Point.ByCartesianCoordinates(coordinateSystem=y_coordinatesystem_rotate_4, z=code_block_40)
byTwoPoints_30 = Vector.ByTwoPoints(start=origin_27, end=byCartesianCoordinates_31)
z_coordinatesystem_rotate_3 = CoordinateSystem.Rotate(coordinateSystem=y_coordinatesystem_rotate_4, origin=origin_27, axis=byTwoPoints_30, degrees=lastItem)
origin_28 = CoordinateSystem.Origin(coordinateSystem=z_coordinatesystem_rotate_3)
origin_29 = CoordinateSystem.Origin(coordinateSystem=translate_9)

# group: Relative Head Height
code_block_41 = CodeBlock { 0.14; }
mul_20 = height * code_block_41

# group: Top of Head
byCartesianCoordinates_32 = Point.ByCartesianCoordinates(coordinateSystem=rotate_9, z=mul_20)

# group: Head Dummy
code_block_42 = CodeBlock { -0.5; }
mul_21 = mul_20 * code_block_42
code_block_43 = CodeBlock { 0.5; }
mul_22 = mul_20 * code_block_43
byCartesianCoordinates_33 = Point.ByCartesianCoordinates(coordinateSystem=rotate_9, x=mul_21, z=mul_22)
byStartPointEndPoint = Line.ByStartPointEndPoint(startPoint=byCartesianCoordinates_32, endPoint=byCartesianCoordinates_33)
byStartPointEndPoint_2 = Line.ByStartPointEndPoint(startPoint=origin_9, endPoint=byCartesianCoordinates_33)
byStartPointEndPoint_3 = Line.ByStartPointEndPoint(startPoint=origin_9, endPoint=byCartesianCoordinates_32)

# group: Neck
byStartPointEndPoint_4 = Line.ByStartPointEndPoint(startPoint=origin_4, endPoint=byCartesianCoordinates_10)

# group: Left Shoulder Joint
code_block_44 = CodeBlock { -0.5; }
mul_23 = mul_6 * code_block_44
byCartesianCoordinates_34 = Point.ByCartesianCoordinates(coordinateSystem=z_coordinatesystem_rotate, y=mul_23)
byTwoPoints_31 = Vector.ByTwoPoints(start=origin_3, end=byCartesianCoordinates_34)
translate_10 = CoordinateSystem.Translate(coordinateSystem=z_coordinatesystem_rotate, direction=byTwoPoints_31)
origin_30 = CoordinateSystem.Origin(coordinateSystem=translate_10)

# group: Shoulder Line
byStartPointEndPoint_5 = Line.ByStartPointEndPoint(startPoint=origin_5, endPoint=origin_30)

# group: Relative Upper Arm Length
code_block_45 = CodeBlock { 0.13; }
mul_24 = height * code_block_45

# group: Right Elbow Joint
code_block_46 = CodeBlock { -1; }
mul_25 = mul_24 * code_block_46
byCartesianCoordinates_35 = Point.ByCartesianCoordinates(coordinateSystem=rotate_6, z=mul_25)
byTwoPoints_32 = Vector.ByTwoPoints(start=origin_5, end=byCartesianCoordinates_35)
translate_11 = CoordinateSystem.Translate(coordinateSystem=rotate_6, direction=byTwoPoints_32)
origin_31 = CoordinateSystem.Origin(coordinateSystem=translate_11)

# group: Right Upper Arm
byStartPointEndPoint_6 = Line.ByStartPointEndPoint(startPoint=origin_5, endPoint=origin_31)

# group: Right Forearm
y_rotation_10 = IntegerSlider(0, range=0..170 step 1)  # graph input
z_rotation_9 = IntegerSlider(0, range=-90..90 step 1)  # graph input

# group: Right Lower Arm Rotation around Y Axis
code_block_47 = CodeBlock { 1; }
byCartesianCoordinates_36 = Point.ByCartesianCoordinates(coordinateSystem=translate_11, y=code_block_47)
byTwoPoints_33 = Vector.ByTwoPoints(start=origin_31, end=byCartesianCoordinates_36)
rotate_16 = CoordinateSystem.Rotate(coordinateSystem=translate_11, origin=origin_31, axis=byTwoPoints_33, degrees=y_rotation_10)
origin_32 = CoordinateSystem.Origin(coordinateSystem=rotate_16)

# group: Right Lower Arm Rotation around Z axis OF THE SHOULDER COORDINATE SYSTEM - Final Right Elbow Joint Coordinate System
code_block_48 = CodeBlock { 1; }
byCartesianCoordinates_37 = Point.ByCartesianCoordinates(coordinateSystem=rotate_6, z=code_block_48)
byTwoPoints_34 = Vector.ByTwoPoints(start=origin_32, end=byCartesianCoordinates_37)
rotate_17 = CoordinateSystem.Rotate(coordinateSystem=rotate_16, origin=origin_32, axis=byTwoPoints_34, degrees=z_rotation_9)
origin_33 = CoordinateSystem.Origin(coordinateSystem=rotate_17)

# group: Relative Lower Arm Length
code_block_49 = CodeBlock { 0.15; }
mul_26 = height * code_block_49

# group: Right Wrist Joint
code_block_50 = CodeBlock { -1; }
mul_27 = mul_26 * code_block_50
byCartesianCoordinates_38 = Point.ByCartesianCoordinates(coordinateSystem=rotate_17, z=mul_27)
byTwoPoints_35 = Vector.ByTwoPoints(start=origin_33, end=byCartesianCoordinates_38)
translate_12 = CoordinateSystem.Translate(coordinateSystem=rotate_17, direction=byTwoPoints_35)
origin_34 = CoordinateSystem.Origin(coordinateSystem=translate_12)

# group: Right Lower Arm
byStartPointEndPoint_7 = Line.ByStartPointEndPoint(startPoint=origin_33, endPoint=origin_34)

# group: Body Spine
byStartPointEndPoint_8 = Line.ByStartPointEndPoint(startPoint=origin_2, endPoint=origin_3)

# group: Left Upper Arm
y_rotation_11 = IntegerSlider(0, range=-90..180 step 1)  # graph input
x_rotation_6 = IntegerSlider(0, range=0..110 step 1)  # graph input
z_rotation_10 = IntegerSlider(0, range=-90..90 step 1)  # graph input

# group: Left Upper Arm Rotation around Y Axis
code_block_51 = CodeBlock { 1; }
byCartesianCoordinates_39 = Point.ByCartesianCoordinates(coordinateSystem=translate_10, y=code_block_51)
byTwoPoints_36 = Vector.ByTwoPoints(start=origin_30, end=byCartesianCoordinates_39)
rotate_18 = CoordinateSystem.Rotate(coordinateSystem=translate_10, origin=origin_30, axis=byTwoPoints_36, degrees=y_rotation_11)
origin_35 = CoordinateSystem.Origin(coordinateSystem=rotate_18)

# group: Left Upper Arm Rotation around (possible new, because already rotated) X axis
code_block_52 = CodeBlock { -1; }
byCartesianCoordinates_40 = Point.ByCartesianCoordinates(coordinateSystem=rotate_18, x=code_block_52)
byTwoPoints_37 = Vector.ByTwoPoints(start=origin_35, end=byCartesianCoordinates_40)
rotate_19 = CoordinateSystem.Rotate(coordinateSystem=rotate_18, origin=origin_35, axis=byTwoPoints_37, degrees=x_rotation_6)
origin_36 = CoordinateSystem.Origin(coordinateSystem=rotate_19)

# group: Left Upper Arm Rotation around (possibly new) Z axis - Final Left Shoulder Joint Coordinate System
code_block_53 = CodeBlock { 1; }
byCartesianCoordinates_41 = Point.ByCartesianCoordinates(coordinateSystem=rotate_19, z=code_block_53)
byTwoPoints_38 = Vector.ByTwoPoints(start=origin_36, end=byCartesianCoordinates_41)
rotate_20 = CoordinateSystem.Rotate(coordinateSystem=rotate_19, origin=origin_36, axis=byTwoPoints_38, degrees=z_rotation_10)
origin_37 = CoordinateSystem.Origin(coordinateSystem=rotate_20)

# group: Left Elbow Joint
code_block_54 = CodeBlock { -1; }
mul_28 = mul_24 * code_block_54
byCartesianCoordinates_42 = Point.ByCartesianCoordinates(coordinateSystem=rotate_20, z=mul_28)
byTwoPoints_39 = Vector.ByTwoPoints(start=origin_37, end=byCartesianCoordinates_42)
translate_13 = CoordinateSystem.Translate(coordinateSystem=rotate_20, direction=byTwoPoints_39)
origin_38 = CoordinateSystem.Origin(coordinateSystem=translate_13)

# group: Left Upper Arm
byStartPointEndPoint_9 = Line.ByStartPointEndPoint(startPoint=origin_30, endPoint=origin_38)

# group: Left Forearm
y_rotation_12 = IntegerSlider(0, range=0..170 step 1)  # graph input
z_rotation_11 = IntegerSlider(0, range=-90..90 step 1)  # graph input

# group: Left Lower Arm Rotation around Y Axis
code_block_55 = CodeBlock { 1; }
byCartesianCoordinates_43 = Point.ByCartesianCoordinates(coordinateSystem=translate_13, y=code_block_55)
byTwoPoints_40 = Vector.ByTwoPoints(start=origin_38, end=byCartesianCoordinates_43)
rotate_21 = CoordinateSystem.Rotate(coordinateSystem=translate_13, origin=origin_38, axis=byTwoPoints_40, degrees=y_rotation_12)
origin_39 = CoordinateSystem.Origin(coordinateSystem=rotate_21)

# group: Left Lower Arm Rotation around Z axis OF THE SHOULDER COORDINATE SYSTEM - Final Right Elbow Joint Coordinate System
code_block_56 = CodeBlock { 1; }
byCartesianCoordinates_44 = Point.ByCartesianCoordinates(coordinateSystem=rotate_20, z=code_block_56)
byTwoPoints_41 = Vector.ByTwoPoints(start=origin_39, end=byCartesianCoordinates_44)
rotate_22 = CoordinateSystem.Rotate(coordinateSystem=rotate_21, origin=origin_39, axis=byTwoPoints_41, degrees=z_rotation_11)
origin_40 = CoordinateSystem.Origin(coordinateSystem=rotate_22)

# group: Left Wrist Joint
code_block_57 = CodeBlock { -1; }
mul_29 = mul_26 * code_block_57
byCartesianCoordinates_45 = Point.ByCartesianCoordinates(coordinateSystem=rotate_22, z=mul_29)
byTwoPoints_42 = Vector.ByTwoPoints(start=origin_40, end=byCartesianCoordinates_45)
translate_14 = CoordinateSystem.Translate(coordinateSystem=rotate_22, direction=byTwoPoints_42)
origin_41 = CoordinateSystem.Origin(coordinateSystem=translate_14)

# group: Left Lower Arm
byStartPointEndPoint_10 = Line.ByStartPointEndPoint(startPoint=origin_40, endPoint=origin_41)

# group: Hip Line
byStartPointEndPoint_11 = Line.ByStartPointEndPoint(startPoint=origin_16, endPoint=origin_24)

# group: Right Thigh
byStartPointEndPoint_12 = Line.ByStartPointEndPoint(startPoint=origin_16, endPoint=origin_17)

# group: Right Lower Leg
byStartPointEndPoint_13 = Line.ByStartPointEndPoint(startPoint=origin_17, endPoint=origin_19)

# group: Left Thigh
byStartPointEndPoint_14 = Line.ByStartPointEndPoint(startPoint=origin_21, endPoint=origin_25)

# group: Left Lower Leg
byStartPointEndPoint_15 = Line.ByStartPointEndPoint(startPoint=origin_25, endPoint=origin_27)

# group: Right Wrist
y_rotation_13 = IntegerSlider(0, range=-45..15 step 1)  # graph input
x_rotation_7 = IntegerSlider(0, range=-90..90 step 1)  # graph input

# group: Right Wrist Rotation around Y Axis
code_block_58 = CodeBlock { 1; }
byCartesianCoordinates_46 = Point.ByCartesianCoordinates(coordinateSystem=translate_12, y=code_block_58)
byTwoPoints_43 = Vector.ByTwoPoints(start=origin_34, end=byCartesianCoordinates_46)
rotate_23 = CoordinateSystem.Rotate(coordinateSystem=translate_12, origin=origin_34, axis=byTwoPoints_43, degrees=y_rotation_13)
origin_42 = CoordinateSystem.Origin(coordinateSystem=rotate_23)

# group: Right Wrist Rotation around X Axis - Final Right Wrist Joint Coordinate System
code_block_59 = CodeBlock { 1; }
byCartesianCoordinates_47 = Point.ByCartesianCoordinates(coordinateSystem=rotate_23, x=code_block_59)
byTwoPoints_44 = Vector.ByTwoPoints(start=origin_42, end=byCartesianCoordinates_47)
rotate_24 = CoordinateSystem.Rotate(coordinateSystem=rotate_23, origin=origin_42, axis=byTwoPoints_44, degrees=x_rotation_7)
origin_43 = CoordinateSystem.Origin(coordinateSystem=rotate_24)

# group: Relative Hand Length
code_block_60 = CodeBlock { 0.11; }
mul_30 = height * code_block_60

# group: Right Hand Dummy
code_block_61 = CodeBlock { -0.2; }
mul_31 = mul_30 * code_block_61
code_block_62 = CodeBlock { -1; }
mul_32 = mul_30 * code_block_62
code_block_63 = CodeBlock { 0.8; }
mul_33 = mul_32 * code_block_63
byCartesianCoordinates_48 = Point.ByCartesianCoordinates(coordinateSystem=rotate_24, x=mul_31, z=mul_33)
byStartPointEndPoint_16 = Line.ByStartPointEndPoint(startPoint=origin_43, endPoint=byCartesianCoordinates_48)
byCartesianCoordinates_49 = Point.ByCartesianCoordinates(coordinateSystem=rotate_24, z=mul_32)
byStartPointEndPoint_17 = Line.ByStartPointEndPoint(startPoint=origin_43, endPoint=byCartesianCoordinates_49)
code_block_64 = CodeBlock { 0.2; }
mul_34 = mul_30 * code_block_64
code_block_65 = CodeBlock { 0.8; }
mul_35 = mul_32 * code_block_65
byCartesianCoordinates_50 = Point.ByCartesianCoordinates(coordinateSystem=rotate_24, x=mul_34, z=mul_35)
byStartPointEndPoint_18 = Line.ByStartPointEndPoint(startPoint=origin_43, endPoint=byCartesianCoordinates_50)

# group: Left Wrist
y_rotation_14 = IntegerSlider(0, range=-45..15 step 1)  # graph input
x_rotation_8 = IntegerSlider(0, range=-90..90 step 1)  # graph input

# group: Left Wrist Rotation around Y Axis
code_block_66 = CodeBlock { 1; }
byCartesianCoordinates_51 = Point.ByCartesianCoordinates(coordinateSystem=translate_14, y=code_block_66)
byTwoPoints_45 = Vector.ByTwoPoints(start=origin_41, end=byCartesianCoordinates_51)
rotate_25 = CoordinateSystem.Rotate(coordinateSystem=translate_14, origin=origin_41, axis=byTwoPoints_45, degrees=y_rotation_14)
origin_44 = CoordinateSystem.Origin(coordinateSystem=rotate_25)

# group: Left Wrist Rotation around X Axis - Final Right Wrist Joint Coordinate System
code_block_67 = CodeBlock { 1; }
byCartesianCoordinates_52 = Point.ByCartesianCoordinates(coordinateSystem=rotate_25, x=code_block_67)
byTwoPoints_46 = Vector.ByTwoPoints(start=origin_44, end=byCartesianCoordinates_52)
rotate_26 = CoordinateSystem.Rotate(coordinateSystem=rotate_25, origin=origin_44, axis=byTwoPoints_46, degrees=x_rotation_8)
origin_45 = CoordinateSystem.Origin(coordinateSystem=rotate_26)

# group: Left Hand Dummy
code_block_68 = CodeBlock { -0.2; }
mul_36 = mul_30 * code_block_68
code_block_69 = CodeBlock { -1; }
mul_37 = mul_30 * code_block_69
code_block_70 = CodeBlock { 0.8; }
mul_38 = mul_37 * code_block_70
byCartesianCoordinates_53 = Point.ByCartesianCoordinates(coordinateSystem=rotate_26, x=mul_36, z=mul_38)
byStartPointEndPoint_19 = Line.ByStartPointEndPoint(startPoint=origin_45, endPoint=byCartesianCoordinates_53)
byCartesianCoordinates_54 = Point.ByCartesianCoordinates(coordinateSystem=rotate_26, z=mul_37)
byStartPointEndPoint_20 = Line.ByStartPointEndPoint(startPoint=origin_45, endPoint=byCartesianCoordinates_54)
code_block_71 = CodeBlock { 0.2; }
mul_39 = mul_30 * code_block_71
code_block_72 = CodeBlock { 0.8; }
mul_40 = mul_37 * code_block_72
byCartesianCoordinates_55 = Point.ByCartesianCoordinates(coordinateSystem=rotate_26, x=mul_39, z=mul_40)
byStartPointEndPoint_21 = Line.ByStartPointEndPoint(startPoint=origin_45, endPoint=byCartesianCoordinates_55)

# group: Skeleton Curves
list_create_9 = List.Create(item0=byStartPointEndPoint, item1=byStartPointEndPoint_2, item2=byStartPointEndPoint_3, item3=byStartPointEndPoint_4, item4=byStartPointEndPoint_5, item5=byStartPointEndPoint_6, item6=byStartPointEndPoint_7, item7=byStartPointEndPoint_8, item8=byStartPointEndPoint_9, item9=byStartPointEndPoint_10, item10=byStartPointEndPoint_11, item11=byStartPointEndPoint_12, item12=byStartPointEndPoint_13, item13=byStartPointEndPoint_14, item14=byStartPointEndPoint_15, item15=byStartPointEndPoint_16, item16=byStartPointEndPoint_17, item17=byStartPointEndPoint_18, item18=byStartPointEndPoint_19, item19=byStartPointEndPoint_20, item20=byStartPointEndPoint_21)

create_skeleton = ComboBoxNode("No", ItemList=[{Name: "Yes", Item: "0"}, {Name: "No", Item: "1"}], IsRadio=false)  # graph input

# group: Send Skeleton to Alias?
code_block_73 = CodeBlock { []; }
list_create_10 = List.Create(item0=list_create_9, item1=code_block_73)
getItemAtIndex_6 = List.GetItemAtIndex(list=list_create_10, index=create_skeleton)

# group: Head Center
code_block_74 = CodeBlock { -0.05; }
mul_41 = mul_20 * code_block_74
code_block_75 = CodeBlock { 0.45; }
mul_42 = mul_20 * code_block_75
translate_15 = CoordinateSystem.Translate(coordinateSystem=rotate_9, xTranslation=mul_41, zTranslation=mul_42)

body_shape = ComboBoxNode("Male", ItemList=[{Name: "Male", Item: "0"}, {Name: "Female", Item: "1"}], IsRadio=false)  # graph input

# group: Male or Female Body Shape?
# Delivers the right file name and path on disk for the wanted Body Shape
file_path = Filename(".\male-torso.tss")
code_block_76 = CodeBlock { "male-torso.tss"; }
code_block_77 = CodeBlock { "female-torso.tss"; }
replace = String.Replace(string=file_path, searchFor=code_block_76, replaceWith=code_block_77)
list_create_11 = List.Create(item0=file_path, item1=replace)
getItemAtIndex_7 = List.GetItemAtIndex(list=list_create_11, index=body_shape)

# group: Transform subdiv torso according to skeleton transformation
importFromTSS = TSpline.TSplineSurface.ImportFromTSS(filePath=getItemAtIndex_7)
byOrigin_2 = CoordinateSystem.ByOrigin()
transform = Geometry.Transform(geometry=importFromTSS, fromCoordinateSystem=byOrigin_2, contextCoordinateSystem=rotate_3)

# group: Scale according to height (base is 180cm)
XYPlane = CoordinateSystem.XYPlane(coordinateSystem=rotate_3)
code_block_78 = CodeBlock { 1800; }
div = height / code_block_78
scale = Geometry.Scale(geometry=transform, plane=XYPlane, xamount=div, yamount=div, zamount=div)

# group: Male or Female Body Shape?
# Delivers the right file name and path on disk for the wanted Body Shape
file_path_2 = Filename(".\male-left-upper-leg.tss")
code_block_79 = CodeBlock { "male-left-upper-leg.tss"; }
code_block_80 = CodeBlock { "female-left-upper-leg.tss"; }
replace_2 = String.Replace(string=file_path_2, searchFor=code_block_79, replaceWith=code_block_80)
list_create_12 = List.Create(item0=file_path_2, item1=replace_2)
getItemAtIndex_8 = List.GetItemAtIndex(list=list_create_12, index=body_shape)

# group: Import Left Upper Leg
importFromTSS_2 = TSpline.TSplineSurface.ImportFromTSS(filePath=getItemAtIndex_8)

# group: Move to Hip Center Point
# The whole manekin is build from the Hip Center Point, so we first need to move it there.
byOrigin_3 = CoordinateSystem.ByOrigin()
transform_2 = Geometry.Transform(geometry=importFromTSS_2, fromCoordinateSystem=byOrigin_3, contextCoordinateSystem=byOrigin)

# group: Right Upper Leg
ZXPlane = CoordinateSystem.ZXPlane(coordinateSystem=byOrigin)
mirror_2 = Geometry.Mirror(geometry=transform_2, mirrorPlane=ZXPlane)

# group: Final position
transform_3 = Geometry.Transform(geometry=mirror_2, fromCoordinateSystem=byOrigin, contextCoordinateSystem=rotate_12)

# group: Scale according to height (base is 180cm)
XYPlane_2 = CoordinateSystem.XYPlane(coordinateSystem=rotate_12)
code_block_81 = CodeBlock { 1800; }
div_2 = height / code_block_81
scale_2 = Geometry.Scale(geometry=transform_3, plane=XYPlane_2, xamount=div_2, yamount=div_2, zamount=div_2)

# group: Final position
transform_4 = Geometry.Transform(geometry=transform_2, fromCoordinateSystem=byOrigin, contextCoordinateSystem=rotate_15)

# group: Scale according to height (base is 180cm)
XYPlane_3 = CoordinateSystem.XYPlane(coordinateSystem=rotate_15)
code_block_82 = CodeBlock { 1800; }
div_3 = height / code_block_82
scale_3 = Geometry.Scale(geometry=transform_4, plane=XYPlane_3, xamount=div_3, yamount=div_3, zamount=div_3)

# group: Male or Female Body Shape?
# Delivers the right file name and path on disk for the wanted Body Shape
file_path_3 = Filename(".\male-left-lower-leg.tss")
code_block_83 = CodeBlock { "male-left-lower-leg.tss"; }
code_block_84 = CodeBlock { "female-left-lower-leg.tss"; }
replace_3 = String.Replace(string=file_path_3, searchFor=code_block_83, replaceWith=code_block_84)
list_create_13 = List.Create(item0=file_path_3, item1=replace_3)
getItemAtIndex_9 = List.GetItemAtIndex(list=list_create_13, index=body_shape)

# group: Import Left Lower Leg
importFromTSS_3 = TSpline.TSplineSurface.ImportFromTSS(filePath=getItemAtIndex_9)

# group: Move to Hip Center Point
# The whole manekin is build from the Hip Center Point, so we first need to move it there.
byOrigin_4 = CoordinateSystem.ByOrigin()
transform_5 = Geometry.Transform(geometry=importFromTSS_3, fromCoordinateSystem=byOrigin_4, contextCoordinateSystem=byOrigin)

# group: Right Lower Leg
ZXPlane_2 = CoordinateSystem.ZXPlane(coordinateSystem=byOrigin)
mirror_3 = Geometry.Mirror(geometry=transform_5, mirrorPlane=ZXPlane_2)

# group: Final position
transform_6 = Geometry.Transform(geometry=mirror_3, fromCoordinateSystem=byOrigin, contextCoordinateSystem=y_coordinatesystem_rotate)

# group: Scale according to height (base is 180cm)
XYPlane_4 = CoordinateSystem.XYPlane(coordinateSystem=y_coordinatesystem_rotate)
code_block_85 = CodeBlock { 1800; }
div_4 = height / code_block_85
scale_4 = Geometry.Scale(geometry=transform_6, plane=XYPlane_4, xamount=div_4, yamount=div_4, zamount=div_4)

# group: Final position
transform_7 = Geometry.Transform(geometry=transform_5, fromCoordinateSystem=byOrigin, contextCoordinateSystem=y_coordinatesystem_rotate_3)

# group: Scale according to height (base is 180cm)
XYPlane_5 = CoordinateSystem.XYPlane(coordinateSystem=y_coordinatesystem_rotate_3)
code_block_86 = CodeBlock { 1800; }
div_5 = height / code_block_86
scale_5 = Geometry.Scale(geometry=transform_7, plane=XYPlane_5, xamount=div_5, yamount=div_5, zamount=div_5)

# group: Male or Female Body Shape?
# Delivers the right file name and path on disk for the wanted Body Shape
file_path_4 = Filename(".\male-left-foot.tss")
code_block_87 = CodeBlock { "male-left-foot.tss"; }
code_block_88 = CodeBlock { "female-left-foot.tss"; }
replace_4 = String.Replace(string=file_path_4, searchFor=code_block_87, replaceWith=code_block_88)
list_create_14 = List.Create(item0=file_path_4, item1=replace_4)
getItemAtIndex_10 = List.GetItemAtIndex(list=list_create_14, index=body_shape)

# group: Import Left Foot
importFromTSS_4 = TSpline.TSplineSurface.ImportFromTSS(filePath=getItemAtIndex_10)

# group: Move to Hip Center Point
# The whole manekin is build from the Hip Center Point, so we first need to move it there.
byOrigin_5 = CoordinateSystem.ByOrigin()
transform_8 = Geometry.Transform(geometry=importFromTSS_4, fromCoordinateSystem=byOrigin_5, contextCoordinateSystem=byOrigin)

# group: Right Foot
ZXPlane_3 = CoordinateSystem.ZXPlane(coordinateSystem=byOrigin)
mirror_4 = Geometry.Mirror(geometry=transform_8, mirrorPlane=ZXPlane_3)

# group: Final position
transform_9 = Geometry.Transform(geometry=mirror_4, fromCoordinateSystem=byOrigin, contextCoordinateSystem=z_coordinatesystem_rotate_2)

# group: Scale according to height (base is 180cm)
XYPlane_6 = CoordinateSystem.XYPlane(coordinateSystem=z_coordinatesystem_rotate_2)
code_block_89 = CodeBlock { 1800; }
div_6 = height / code_block_89
scale_6 = Geometry.Scale(geometry=transform_9, plane=XYPlane_6, xamount=div_6, yamount=div_6, zamount=div_6)

# group: Final position
transform_10 = Geometry.Transform(geometry=transform_8, fromCoordinateSystem=byOrigin, contextCoordinateSystem=z_coordinatesystem_rotate_3)

# group: Scale according to height (base is 180cm)
XYPlane_7 = CoordinateSystem.XYPlane(coordinateSystem=z_coordinatesystem_rotate_3)
code_block_90 = CodeBlock { 1800; }
div_7 = height / code_block_90
scale_7 = Geometry.Scale(geometry=transform_10, plane=XYPlane_7, xamount=div_7, yamount=div_7, zamount=div_7)

# group: Male or Female Body Shape?
# Delivers the right file name and path on disk for the wanted Body Shape
file_path_5 = Filename(".\male-head.tss")
code_block_91 = CodeBlock { "male-head.tss"; }
code_block_92 = CodeBlock { "female-head.tss"; }
replace_5 = String.Replace(string=file_path_5, searchFor=code_block_91, replaceWith=code_block_92)
list_create_15 = List.Create(item0=file_path_5, item1=replace_5)
getItemAtIndex_11 = List.GetItemAtIndex(list=list_create_15, index=body_shape)

# group: Import Head
importFromTSS_5 = TSpline.TSplineSurface.ImportFromTSS(filePath=getItemAtIndex_11)

# group: Move to Hip Center Point
# The whole manekin is build from the Hip Center Point, so we first need to move it there.
byOrigin_6 = CoordinateSystem.ByOrigin()
transform_11 = Geometry.Transform(geometry=importFromTSS_5, fromCoordinateSystem=byOrigin_6, contextCoordinateSystem=byOrigin)

# group: Final position
transform_12 = Geometry.Transform(geometry=transform_11, fromCoordinateSystem=byOrigin, contextCoordinateSystem=rotate_9)

# group: Scale according to height (base is 180cm)
XYPlane_8 = CoordinateSystem.XYPlane(coordinateSystem=rotate_9)
code_block_93 = CodeBlock { 1800; }
div_8 = height / code_block_93
scale_8 = Geometry.Scale(geometry=transform_12, plane=XYPlane_8, xamount=div_8, yamount=div_8, zamount=div_8)

# group: Male or Female Body Shape?
# Delivers the right file name and path on disk for the wanted Body Shape
file_path_6 = Filename(".\male-left-lower-arm.tss")
code_block_94 = CodeBlock { "male-left-lower-arm.tss"; }
code_block_95 = CodeBlock { "female-left-lower-arm.tss"; }
replace_6 = String.Replace(string=file_path_6, searchFor=code_block_94, replaceWith=code_block_95)
list_create_16 = List.Create(item0=file_path_6, item1=replace_6)
getItemAtIndex_12 = List.GetItemAtIndex(list=list_create_16, index=body_shape)

# group: Import Left Lower Arm
importFromTSS_6 = TSpline.TSplineSurface.ImportFromTSS(filePath=getItemAtIndex_12)

# group: Move to Hip Center Point
# The whole manekin is build from the Hip Center Point, so we first need to move it there.
byOrigin_7 = CoordinateSystem.ByOrigin()
transform_13 = Geometry.Transform(geometry=importFromTSS_6, fromCoordinateSystem=byOrigin_7, contextCoordinateSystem=byOrigin)

# group: Right Lower Arm
ZXPlane_4 = CoordinateSystem.ZXPlane(coordinateSystem=byOrigin)
mirror_5 = Geometry.Mirror(geometry=transform_13, mirrorPlane=ZXPlane_4)

# group: Final position
transform_14 = Geometry.Transform(geometry=mirror_5, fromCoordinateSystem=byOrigin, contextCoordinateSystem=rotate_17)

# group: Scale according to height (base is 180cm)
XYPlane_9 = CoordinateSystem.XYPlane(coordinateSystem=rotate_17)
code_block_96 = CodeBlock { 1800; }
div_9 = height / code_block_96
scale_9 = Geometry.Scale(geometry=transform_14, plane=XYPlane_9, xamount=div_9, yamount=div_9, zamount=div_9)

# group: Final position
transform_15 = Geometry.Transform(geometry=transform_13, fromCoordinateSystem=byOrigin, contextCoordinateSystem=rotate_22)

# group: Scale according to height (base is 180cm)
XYPlane_10 = CoordinateSystem.XYPlane(coordinateSystem=rotate_22)
code_block_97 = CodeBlock { 1800; }
div_10 = height / code_block_97
scale_10 = Geometry.Scale(geometry=transform_15, plane=XYPlane_10, xamount=div_10, yamount=div_10, zamount=div_10)

# group: Male or Female Body Shape?
# Delivers the right file name and path on disk for the wanted Body Shape
file_path_7 = Filename(".\male-left-upper-arm.tss")
code_block_98 = CodeBlock { "male-left-upper-arm.tss"; }
code_block_99 = CodeBlock { "female-left-upper-arm.tss"; }
replace_7 = String.Replace(string=file_path_7, searchFor=code_block_98, replaceWith=code_block_99)
list_create_17 = List.Create(item0=file_path_7, item1=replace_7)
getItemAtIndex_13 = List.GetItemAtIndex(list=list_create_17, index=body_shape)

# group: Import Left Upper Arm
importFromTSS_7 = TSpline.TSplineSurface.ImportFromTSS(filePath=getItemAtIndex_13)

# group: Move to Hip Center Point
# The whole manekin is build from the Hip Center Point, so we first need to move it there.
byOrigin_8 = CoordinateSystem.ByOrigin()
transform_16 = Geometry.Transform(geometry=importFromTSS_7, fromCoordinateSystem=byOrigin_8, contextCoordinateSystem=byOrigin)

# group: Right Upper Arm
ZXPlane_5 = CoordinateSystem.ZXPlane(coordinateSystem=byOrigin)
mirror_6 = Geometry.Mirror(geometry=transform_16, mirrorPlane=ZXPlane_5)

# group: Final position
transform_17 = Geometry.Transform(geometry=mirror_6, fromCoordinateSystem=byOrigin, contextCoordinateSystem=rotate_6)

# group: Scale according to height (base is 180cm)
XYPlane_11 = CoordinateSystem.XYPlane(coordinateSystem=rotate_6)
code_block_100 = CodeBlock { 1800; }
div_11 = height / code_block_100
scale_11 = Geometry.Scale(geometry=transform_17, plane=XYPlane_11, xamount=div_11, yamount=div_11, zamount=div_11)

# group: Final position
transform_18 = Geometry.Transform(geometry=transform_16, fromCoordinateSystem=byOrigin, contextCoordinateSystem=rotate_20)

# group: Scale according to height (base is 180cm)
XYPlane_12 = CoordinateSystem.XYPlane(coordinateSystem=rotate_20)
code_block_101 = CodeBlock { 1800; }
div_12 = height / code_block_101
scale_12 = Geometry.Scale(geometry=transform_18, plane=XYPlane_12, xamount=div_12, yamount=div_12, zamount=div_12)

# group: Male or Female Body Shape?
# Delivers the right file name and path on disk for the wanted Body Shape
file_path_8 = Filename(".\male-left-hand.tss")
code_block_102 = CodeBlock { "male-left-hand.tss"; }
code_block_103 = CodeBlock { "female-left-hand.tss"; }
replace_8 = String.Replace(string=file_path_8, searchFor=code_block_102, replaceWith=code_block_103)
list_create_18 = List.Create(item0=file_path_8, item1=replace_8)
getItemAtIndex_14 = List.GetItemAtIndex(list=list_create_18, index=body_shape)

# group: Import Left Hand
importFromTSS_8 = TSpline.TSplineSurface.ImportFromTSS(filePath=getItemAtIndex_14)

# group: Move to Hip Center Point
# The whole manekin is build from the Hip Center Point, so we first need to move it there.
byOrigin_9 = CoordinateSystem.ByOrigin()
transform_19 = Geometry.Transform(geometry=importFromTSS_8, fromCoordinateSystem=byOrigin_9, contextCoordinateSystem=byOrigin)

# group: Right Hand
ZXPlane_6 = CoordinateSystem.ZXPlane(coordinateSystem=byOrigin)
mirror_7 = Geometry.Mirror(geometry=transform_19, mirrorPlane=ZXPlane_6)

# group: Final position
transform_20 = Geometry.Transform(geometry=mirror_7, fromCoordinateSystem=byOrigin, contextCoordinateSystem=rotate_24)

# group: Scale according to height (base is 180cm)
XYPlane_13 = CoordinateSystem.XYPlane(coordinateSystem=rotate_24)
code_block_104 = CodeBlock { 1800; }
div_13 = height / code_block_104
scale_13 = Geometry.Scale(geometry=transform_20, plane=XYPlane_13, xamount=div_13, yamount=div_13, zamount=div_13)

# group: Final position
transform_21 = Geometry.Transform(geometry=transform_19, fromCoordinateSystem=byOrigin, contextCoordinateSystem=rotate_26)

# group: Scale according to height (base is 180cm)
XYPlane_14 = CoordinateSystem.XYPlane(coordinateSystem=rotate_26)
code_block_105 = CodeBlock { 1800; }
div_14 = height / code_block_105
scale_14 = Geometry.Scale(geometry=transform_21, plane=XYPlane_14, xamount=div_14, yamount=div_14, zamount=div_14)

# group: Subdiv Body Parts
list_create_19 = List.Create(item0=scale, item1=scale_2, item2=scale_3, item3=scale_4, item4=scale_5, item5=scale_6, item6=scale_7, item7=scale_8, item8=scale_9, item9=scale_10, item10=scale_11, item11=scale_12, item12=scale_13, item13=scale_14)

create_subdiv_body = ComboBoxNode("Yes", ItemList=[{Name: "Yes", Item: "0"}, {Name: "No", Item: "1"}], IsRadio=false)  # graph input

# group: Send Subdiv Body to Alias?
code_block_106 = CodeBlock { []; }
list_create_20 = List.Create(item0=list_create_19, item1=code_block_106)
getItemAtIndex_15 = List.GetItemAtIndex(list=list_create_20, index=create_subdiv_body)

# group: ToDo
code_block_107 = CodeBlock()
# ---------- code_block_107.designscript (9 lines) ----------
/*
Make Should rotation possible with imported TSS

Implement "Pointing", where Alias given points drive the orientation
of the manekin limbs.

Implement "Field of vision", where cones displayed show
what the manekin can currently see.
*/;
# ----------------------------------------
