# Dynamo graph Point.Pruneduplicates.dyn (Dynamo 2.10.0.3076)

file_path = Filename("data\point.pruneduplicates_path.sat")
importFromSAT = Geometry.ImportFromSAT(file=file_path)
code_block = CodeBlock { 0..1..#100; }
pointAtParameter = Curve.PointAtParameter(curve=importFromSAT, param=code_block, lacing=CrossProduct)
flatten = List.Flatten(list=pointAtParameter)
pruneDuplicates = Point.PruneDuplicates(points=flatten)

# group: join path curves
byJoinedCurves = PolyCurve.ByJoinedCurves(curves=importFromSAT)

parameterAtPoint = Curve.ParameterAtPoint(curve=byJoinedCurves)  # unwired: point
sortByFunction = List.SortByFunction(list=pruneDuplicates, sortFunction=parameterAtPoint)

# group: rebuild the path
byPoints = PolyCurve.ByPoints(points=sortByFunction)

code_block_2 = CodeBlock {  }
