# Dynamo graph PointsLinesCircles.dyn (Dynamo 2.5.0.6337)

number = DoubleInput(50)
code_block = CodeBlock(B=number) { 0..B..2; }
byCoordinates = Vector.ByCoordinates(x=code_block, y=code_block, z=code_block, lacing=CrossProduct)
X = Vector.X(vector=byCoordinates)
length = Vector.Length(vector=byCoordinates)
number_2 = DoubleInput(100)
code_block_2 = CodeBlock(A=number_2) { -2..-A..-2; }
byCoordinates_2 = Point.ByCoordinates(x=code_block_2, y=code_block_2, lacing=CrossProduct)
code_block_3 = CodeBlock(A=number_2) { 2..A..2; }
byCoordinates_3 = Point.ByCoordinates(x=code_block_3, y=code_block_2, lacing=CrossProduct)
byStartPointEndPoint = Line.ByStartPointEndPoint(startPoint=byCoordinates_2@L2, endPoint=byCoordinates_3)
endPoint = Curve.EndPoint(curve=byStartPointEndPoint)
byCoordinates_4 = Point.ByCoordinates(x=code_block, y=code_block, z=code_block, lacing=CrossProduct)
byCenterPointRadius = Circle.ByCenterPointRadius(centerPoint=byCoordinates_4)
centerPoint = Circle.CenterPoint(circle=byCenterPointRadius)
normal = Curve.Normal(curve=byCenterPointRadius)
byLengths = Cuboid.ByLengths(origin=byCoordinates_4)
