# Dynamo graph Points_Distance_To.dyn (Dynamo 2.11.0.4057)

code_block = CodeBlock { Point.ByCoordinates(0,0,0); }
code_block_2 = CodeBlock { 0..40; }
byCoordinates = Point.ByCoordinates(x=code_block_2, y=code_block_2, z=code_block_2, lacing=CrossProduct)
code_block_3 = CodeBlock { 5; }
translate = Geometry.Translate(geometry=byCoordinates, xTranslation=code_block_3)
distanceTo = Geometry.DistanceTo(geometry=code_block, other=translate)
