# Dynamo graph Pottery.dyn (Dynamo 2.3.0.4415)

number_of_sides_3 = CodeBlock { 3; }
height_5_40 = DoubleSlider(13, range=1..30 step 1)  # graph input
filletradius_1_1 = CodeBlock { 0.5; }
potteryCustom = Custom[PotteryCustom](numberSides=number_of_sides_3, H=height_5_40, radius=filletradius_1_1)
