# Dynamo custom node PythonCustomNode.dyf "test" (Dynamo 2.11.0.3854)
# category: FFITarget
# test

x = Input(x: var)
python_script = Python(IN[0]=x)  # IronPython2
# ---------- python_script.python (13 lines) ----------
# Load the Python Standard and DesignScript Libraries
import sys
import clr
clr.AddReference('ProtoGeometry')
from Autodesk.DesignScript.Geometry import *

# The inputs to this node will be stored as a list in the IN variables.
dataEnteringNode = IN

# Place your code below this line

# Assign your output to the OUT variable.
OUT = IN[0]
# ----------------------------------------
y = Output(python_script)  # "y: var"
