# Dynamo graph PythonJSONParsing.dyn (Dynamo 2.1.0.8095)

file_path = Filename("data\pokedex.json")
readText = FileSystem.ReadText(file=file_path)
parseJSON = Data.ParseJSON(json=readText)
code_block = CodeBlock { "name"; }
valueAtKey = DesignScript.Builtin.Dictionary.ValueAtKey(dictionary=parseJSON, key=code_block)
code_block_2 = CodeBlock { "Pikachu"; }
indexOf = List.IndexOf(list=valueAtKey, element=code_block_2)
getItemAtIndex = List.GetItemAtIndex(list=parseJSON, index=indexOf)
keys = DesignScript.Builtin.Dictionary.Keys(dictionary=getItemAtIndex)
valueAtKey_2 = DesignScript.Builtin.Dictionary.ValueAtKey(dictionary=getItemAtIndex, key=keys)
flatten = List.Flatten(list=valueAtKey_2)

# group: Parse JSON String in Python
python_script = Python(IN[0]=readText, IN[1]=code_block_2)  # CPython3
# ---------- python_script.python (14 lines) ----------
import json

dataEnteringNode = IN
jsonString = IN[0]
user = IN[1]

jsonObject = json.loads(jsonString)
userData = []
for m in jsonObject:
	if (m["name"] == user):
		userData = m


OUT = userData
# ----------------------------------------
code_block_3 = CodeBlock(out=python_script) { keys = out.Keys; }

valueAtKey_3 = DesignScript.Builtin.Dictionary.ValueAtKey(dictionary=python_script, key=code_block_3)
flatten_2 = List.Flatten(list=valueAtKey_3)
eq = flatten == flatten_2
