# Dynamo graph TSplinesSrf_to_Mesh.dyn (Dynamo 2.0.2.8095)

code_block = CodeBlock { -20..20..10; }
byCoordinates = Point.ByCoordinates(x=code_block, y=code_block, lacing=CrossProduct)
code_block_2 = CodeBlock { 5; }
boolean = BoolSelector(false)
bySphereCenterPointRadius = TSpline.TSplineSurface.BySphereCenterPointRadius(centerPoint=byCoordinates, radius=code_block_2, inSmoothMode=boolean)
toMesh = TSpline.TSplineSurface.ToMesh(tSplineSurface=bySphereCenterPointRadius)
faceIndices = Mesh.FaceIndices(mesh=toMesh)
vertexNormals = Mesh.VertexNormals(mesh=toMesh)
vertexPositions = Mesh.VertexPositions(mesh=toMesh)
