# Dynamo graph Vase.dyn (Dynamo 2.0.2.8095)

supports = IntegerSlider(144, range=0..200 step 1)  # graph input
randomList = Math.RandomList(amount=supports)
randomList_2 = Math.RandomList(amount=supports)
byCoordinates = UV.ByCoordinates(u=randomList, v=randomList_2)
base = DoubleSlider(5, range=0..10 step 0.1)  # graph input
mid = DoubleSlider(5, range=0..10 step 0.1)  # graph input
top = DoubleSlider(5, range=0..10 step 0.1)  # graph input
code_block = CodeBlock(b=base, m=mid, t=top) { Point.ByCoordinates(0,0,3); Point.ByCoordinates(0,b,3); Point.ByCoordinates(0,m,20); Point.ByCoordinates(0,t,30); }
create = List.Create(item0=code_block.out0, item1=code_block.out1, item2=code_block.out2, item3=code_block.out3)
byControlPoints = NurbsCurve.ByControlPoints(points=create)
code_block_2 = CodeBlock { Point.ByCoordinates(0,-0.1); }
code_block_3 = CodeBlock { 360; }
byRevolve = Surface.ByRevolve(profile=byControlPoints, axisOrigin=code_block_2, sweepAngle=code_block_3)
pointAtParameter = Surface.PointAtParameter(surface=byRevolve, u=randomList, v=randomList_2)
code_block_4 = CodeBlock { Point.ByCoordinates(0,0,15); 32; }
code_block_5 = CodeBlock { 15; }
byLengths = Cuboid.ByLengths(origin=code_block_4.out0, width=code_block_5, length=code_block_5, height=code_block_4.out1)
bySolid = PolySurface.BySolid(solid=byLengths)
explode = Geometry.Explode(geometry=bySolid)
code_block_6 = CodeBlock(s=explode) { s[1..5]; }
byJoinedSurfaces = PolySurface.ByJoinedSurfaces(surfaces=code_block_6)
closestPointTo = Geometry.ClosestPointTo(geometry=byJoinedSurfaces, other=pointAtParameter)
byTwoPoints = Vector.ByTwoPoints(start=pointAtParameter, end=closestPointTo)
byWidthLength = Rectangle.ByWidthLength()
code_block_7 = CodeBlock { 1; }
code_block_8 = CodeBlock { Vector.ByCoordinates(0,0,-1); }
byThickeningCurve = PolyCurve.ByThickeningCurve(curve=byControlPoints, thickness=code_block_7, nor=code_block_8)
byRevolve_2 = Solid.ByRevolve(profile=byThickeningCurve, axisOrigin=code_block_2, axisDirection=code_block_8, sweepAngle=code_block_3)
byStartPointEndPoint = Line.ByStartPointEndPoint(startPoint=pointAtParameter, endPoint=closestPointTo)
tangentAtParameter = Curve.TangentAtParameter(curve=byStartPointEndPoint)
byOriginNormal = Plane.ByOriginNormal(origin=pointAtParameter, normal=tangentAtParameter)
support_thickness = DoubleSlider(0.3, range=0.1..1 step 0.1)  # graph input
code_block_9 = CodeBlock(x=support_thickness) { x; }
byWidthLength_2 = Rectangle.ByWidthLength(plane=byOriginNormal, width=code_block_9, length=code_block_9)
bySweep = Solid.BySweep(profile=byWidthLength_2, path=byStartPointEndPoint)
doesIntersect = Geometry.DoesIntersect(geometry=code_block_6, other=closestPointTo, lacing=CrossProduct)
filterByBoolMask = List.FilterByBoolMask(list=closestPointTo)  # unwired: mask
map = List.Map(list=doesIntersect, f_x=filterByBoolMask.in)
closestPointTo_2 = Geometry.ClosestPointTo()  # unwired: geometry, other
perimeterCurves = Surface.PerimeterCurves(surface=code_block_6)
byJoinedCurves = PolyCurve.ByJoinedCurves(curves=perimeterCurves)
combine = List.Combine(comb=closestPointTo_2, list1=byJoinedCurves, list2=map)
byStartPointEndPoint_2 = Line.ByStartPointEndPoint(startPoint=map, endPoint=combine)
tangentAtParameter_2 = Curve.TangentAtParameter(curve=byStartPointEndPoint_2)
byOriginNormal_2 = Plane.ByOriginNormal(origin=map, normal=tangentAtParameter_2)
byWidthLength_3 = Rectangle.ByWidthLength(plane=byOriginNormal_2, width=code_block_9, length=code_block_9)
code_block_10 = CodeBlock(x=code_block_9) { x/2; }
extendStart = Curve.ExtendStart(curve=byStartPointEndPoint_2, distance=code_block_10)
bySweep_2 = Solid.BySweep(profile=byWidthLength_3, path=extendStart)
edges = Topology.Edges(topology=byLengths)
curveGeometry = Edge.CurveGeometry(edge=edges)
startPoint = Curve.StartPoint(curve=curveGeometry)
tangentAtParameter_3 = Curve.TangentAtParameter(curve=curveGeometry)
byOriginNormal_3 = Plane.ByOriginNormal(origin=startPoint, normal=tangentAtParameter_3)
byWidthLength_4 = Rectangle.ByWidthLength(plane=byOriginNormal_3, width=code_block_9, length=code_block_9)
code_block_11 = CodeBlock(x=code_block_9) { x/2; }
extendStart_2 = Curve.ExtendStart(curve=curveGeometry, distance=code_block_11)
bySweep_3 = Solid.BySweep(profile=byWidthLength_4, path=extendStart_2)
create_2 = List.Create(item0=bySweep, item1=bySweep_2, item2=bySweep_3)
flatten = List.Flatten(list=create_2)
list_create = List.Create(item0=byRevolve_2, item1=flatten)
flatten_2 = List.Flatten(list=list_create)
byUnion = Solid.ByUnion(solids=flatten_2)
