# Dynamo graph _JewelCage.dyn (Dynamo 2.3.0.4415)

length_of_tube = DoubleSlider(44.9, range=1..60 step 0.1)  # graph input
number_of_circles = DoubleSlider(13, range=1..30 step 1)  # graph input
code_block = CodeBlock(len=length_of_tube, num=number_of_circles) { 0..len..#num; }
byCoordinates = Point.ByCoordinates(z=code_block)
waveStart = DoubleSlider(49, range=0..100 step 1)  # graph input
waveEnd = DoubleSlider(171, range=70..200 step 1)  # graph input
code_block_2 = CodeBlock(strt=waveStart, end=waveEnd, num=number_of_circles) { strt..end..#num; }
waveAmplitude = DoubleSlider(10.8, range=1..30 step 0.1)  # graph input
code_block_3 = CodeBlock(x=code_block_2, amp=waveAmplitude) { Math.Sin(x)*amp+1; }
code_block_4 = CodeBlock { Vector.ByCoordinates(0,0,1); }
code_block_5 = CodeBlock { 0..1..#10; }
restOfItems = List.RestOfItems(list=code_block_5)

# group: Inner Circle
code_block_6 = CodeBlock(x=code_block_3) { x/2; }
byCenterPointRadiusNormal = Circle.ByCenterPointRadiusNormal(centerPoint=byCoordinates, radius=code_block_6, normal=code_block_4)
pointAtParameter = Curve.PointAtParameter(curve=byCenterPointRadiusNormal, param=restOfItems, lacing=CrossProduct)
transpose = List.Transpose(lists=pointAtParameter)
byPoints = NurbsCurve.ByPoints(points=transpose)

# group: OuterCircle
byCenterPointRadiusNormal_2 = Circle.ByCenterPointRadiusNormal(centerPoint=byCoordinates, radius=code_block_3, normal=code_block_4)
code_block_7 = CodeBlock { 2; }
dropEveryNthItem = List.DropEveryNthItem(list=byCenterPointRadiusNormal_2, n=code_block_7)
pointAtParameter_2 = Curve.PointAtParameter(curve=dropEveryNthItem, param=restOfItems, lacing=CrossProduct)
code_block_8 = CodeBlock(x=pointAtParameter_2) { 0..Count(x)-1; }
shiftIndices = List.ShiftIndices(list=pointAtParameter_2, amount=code_block_8, lacing=Longest)
transpose_2 = List.Transpose(lists=shiftIndices)
byPoints_2 = NurbsCurve.ByPoints(points=transpose_2)

firstItem = List.FirstItem()  # unwired: list
map = List.Map(list=transpose_2, f_x=firstItem)
code_block_9 = CodeBlock { 0.25; }
code_block_10 = CodeBlock { 0; }
tangentAtParameter = Curve.TangentAtParameter(curve=byPoints_2, param=code_block_10)
byCenterPointRadiusNormal_3 = Circle.ByCenterPointRadiusNormal(centerPoint=map, radius=code_block_9, normal=tangentAtParameter)
bySweep = Surface.BySweep(profile=byCenterPointRadiusNormal_3, path=byPoints_2)
XZ = Plane.XZ()
mirror = Geometry.Mirror(geometry=bySweep, mirrorPlane=XZ)
YZ = Plane.YZ()
XY = Plane.XY()

# group: Outer Hoops
reverse = Vector.Reverse(vector=code_block_4)
code_block_11 = CodeBlock { 0.4; }
code_block_12 = CodeBlock(x=code_block_11) { x/2; }
translate = Geometry.Translate(geometry=dropEveryNthItem, direction=reverse, distance=code_block_12)
extrude = Curve.Extrude(curve=translate, direction=code_block_4, distance=code_block_11)
thicken = Surface.Thicken(surface=extrude)

code_block_13 = CodeBlock { Color.ByARGB(255,100,100,0); }
byGeometryColor = Modifiers.GeometryColor.ByGeometryColor(geometry=thicken, color=code_block_13)
