# Dynamo graph aniform03.dyn (Dynamo 2.3.0.4415)

code_block = CodeBlock { 10; }
byCoordinates = Point.ByCoordinates(y=code_block)
code_block_2 = CodeBlock { 5; }
byCenterPointRadius = Sphere.ByCenterPointRadius(centerPoint=byCoordinates, radius=code_block_2)
code_block_3 = CodeBlock { -5; }
byCoordinates_2 = Point.ByCoordinates(y=code_block_3)
byOrigin = CoordinateSystem.ByOrigin(origin=byCoordinates_2)
code_block_4 = CodeBlock { 1; 1; 0.5; }
byCoordinateSystemHeightRadii = Cone.ByCoordinateSystemHeightRadii(cs=byOrigin, height=code_block_4.out0, startRadius=code_block_4.out1, endRadius=code_block_4.out2)
byOrigin_2 = CoordinateSystem.ByOrigin(origin=byCoordinates_2)
code_block_5 = CodeBlock { 3; 0.9; 0.5; }
byCoordinateSystemHeightRadii_2 = Cone.ByCoordinateSystemHeightRadii(cs=byOrigin_2, height=code_block_5.out0, startRadius=code_block_5.out1, endRadius=code_block_5.out2)
code_block_6 = CodeBlock { -0.5; }
byCoordinates_3 = Vector.ByCoordinates(x=code_block_6)
translate = Geometry.Translate(geometry=byCoordinateSystemHeightRadii_2, direction=byCoordinates_3)
difference = Solid.Difference(solid=byCoordinateSystemHeightRadii, other=translate)
edges = Topology.Edges(topology=difference)
code_block_7 = CodeBlock { 0.1; }
fillet = Solid.Fillet(solid=difference, edges=edges, radius=code_block_7)
byOrigin_3 = CoordinateSystem.ByOrigin(origin=byCoordinates)
integer_slider = IntegerSlider(100, range=0..300 step 1)
code_block_8 = CodeBlock(x=integer_slider) { 0..#x..137.50776; }
code_block_9 = CodeBlock(x=integer_slider) { 1..100..#x; }
bySphericalCoordinates = CoordinateSystem.BySphericalCoordinates(cs=byOrigin_3, radius=code_block_2, theta=code_block_8, phi=code_block_9)
transform = Geometry.Transform(geometry=fillet, fromCoordinateSystem=byOrigin, contextCoordinateSystem=bySphericalCoordinates)
XYPlane = CoordinateSystem.XYPlane(coordinateSystem=bySphericalCoordinates)
code_block_10 = CodeBlock { 0.3; 1.5; }
remapRange = Math.RemapRange(numbers=code_block_9, newMin=code_block_10.out0, newMax=code_block_10.out1)
scale = Geometry.Scale(geometry=transform, plane=XYPlane, xamount=remapRange)
