# Dynamo graph create point - end.dyn (Dynamo 0.7.0.19118)

number = DoubleInput(0)
number_2 = DoubleInput(0)
integer_slider = IntegerSlider(19, range=0..100)
byCoordinates = Point.ByCoordinates(number, number_2, integer_slider)
byPoint = ReferencePoint.ByPoint(byCoordinates)
