# Dynamo graph Attractor Logic_Start.dyn (Dynamo 0.7.0.21043)

code_block = CodeBlock { 0..30..#15; 0; }
# note: XYZ Point Grid
byCoordinates = Point.ByCoordinates(code_block.out0, code_block.out0, code_block.out1, lacing=CrossProduct)
number_slider = DoubleSlider(0.939, range=0.1..2)
# note: Circle with variable radii
byCenterPointRadius = Circle.ByCenterPointRadius(byCoordinates, number_slider, lacing=Longest)
watch_3d = Watch3D(byCenterPointRadius)
number_slider_2 = DoubleSlider(25.97, range=0..30)
number_slider_3 = DoubleSlider(19.925, range=0..30)
code_block_2 = CodeBlock { 0; }
# note: 'Attractor' Point
byCoordinates_2 = Point.ByCoordinates(number_slider_2, number_slider_3, code_block_2, lacing=Longest)
watch = Watch(byCoordinates_2)
number = DoubleInput(30)
div = _ / number
# note: Create a distance-based
# relationship with a single point.
distanceTo = Geometry.DistanceTo()
# note: Make Revit Stuff
referenceCurveByCurve = ModelCurve.ReferenceCurveByCurve()
