# Dynamo graph circle.dyn (Dynamo 0.7.0.29588)

number_slider = DoubleSlider(0, range=0..100)
code_block = CodeBlock { 0; }
byCoordinates = Point.ByCoordinates(number_slider, code_block, code_block, lacing=Longest)
number_slider_2 = DoubleSlider(40.909, range=0..100)
byCenterPointRadius = Circle.ByCenterPointRadius(byCoordinates, number_slider_2, lacing=Longest)
byCurve = ModelCurve.ByCurve(byCenterPointRadius, lacing=Longest)
# note: Select curve from Revit.
select_model_element = DSModelElementSelection()
curve = CurveElement.Curve(select_model_element, lacing=Longest)
create_list = List.Create(curve, byCenterPointRadius)
watch_3d = Watch3D(create_list)
