# Dynamo graph tesselation with coincident grids.dyn (Dynamo 0.7.0.38229)

code_block = CodeBlock { 0..1..#27; }
byCoordinates = UV.ByCoordinates(code_block, code_block, lacing=CrossProduct)
code_block_2 = CodeBlock { 0..1..#6; }
byCoordinates_2 = UV.ByCoordinates(code_block_2, code_block_2, lacing=CrossProduct)
create = List.Create(byCoordinates, byCoordinates_2)
flatten = Flatten(create)
select_face = DSFaceSelection()  # 1 picked in the model
byParametersOnSurface = Tessellation.Voronoi.ByParametersOnSurface(flatten, select_face)
watch_3d = Watch3D(byParametersOnSurface)
# note: Connect these to
# make Revit Stuff
byCurve = ModelCurve.ByCurve(lacing=Longest)
