# Dynamo graph ExcelDataExport.dyn (Dynamo 0.7.0.38229)

# note: Write Each Panel as a Row of 12 numbers each to Excel
string = StringInput("C:\Autodesk\Dynamo07\Core\samples\23 Data Import and Export\DataExport.xlsx")
string_2 = StringInput("Sheet1")
code_block = CodeBlock { 0; }
# note: Group XYZ Components as Lists of 3
create_list = List.Create()
number = DoubleInput(19)
number_2 = DoubleInput(1..60..#20)
number_3 = DoubleInput(0)
number_4 = DoubleInput(0)
# note: Define Setting Out Point Geometry
byCoordinates = Point.ByCoordinates(number_2, number_3, number_4, lacing=Longest)
number_5 = DoubleInput(20)
number_6 = DoubleInput(0.4..2.5..#20)
formula = Formula("sin(x)*20", x=number_6, lacing=Longest)
byCoordinates_2 = Point.ByCoordinates(number_2, number_5, formula, lacing=Longest)
formula_2 = Formula("sin(x)*20+20", x=number_6, lacing=Longest)
number_7 = DoubleInput(0)
byCoordinates_3 = Point.ByCoordinates(number_2, formula_2, number_7, lacing=Longest)
create_list_2 = List.Create(byCoordinates, byCoordinates_2, byCoordinates_3)
transpose = List.Transpose(create_list_2)
byPoints = NurbsCurve.ByPoints(transpose, lacing=Longest)
number_8 = DoubleInput(10)
code_block_2 = CodeBlock(x=number_8) { 0..1..#x; }
# note: Create Ribs and Point Arrays on Ribs
pointAtParameter = Curve.PointAtParameter(byPoints, code_block_2, lacing=CrossProduct)
transpose_2 = List.Transpose(pointAtParameter)
flatten = Flatten(transpose_2)
# note: Custom Node.  If this is red, got to Packages>Search for a Package, and search for it by name.  Download, then re-open this dyn file
quads_from_rectangular_grid = Custom[Quads from Rectangular Grid](Row_Number=number, Point_List=flatten)  # Given a grid of points (xyz or uv) create a list of quadrilaterals
flatten_2 = Flatten(quads_from_rectangular_grid)
# note: Extract XYZ Components
X = Point.X(flatten_2, lacing=Longest)
Y = Point.Y(flatten_2, lacing=Longest)
Z = Point.Z(flatten_2, lacing=Longest)
combine = List.Combine(create_list, X, Y, Z)
# note: Make Groups of 12 (4 points, made of 3 pieces of data each)
flatten_3 = Flatten(combine)
number_9 = DoubleInput(12)
chop = List.Chop(flatten_3, number_9)
write = Excel.Write(string, string_2, code_block, code_block, chop)
# note: Define Panel Geometry
byPoints_2 = PolyCurve.ByPoints(quads_from_rectangular_grid)
