# Dynamo graph ExcelDataExtract.dyn (Dynamo 0.7.0.38229)

family_types = FamilyTypes(index=18)
all_elements_of_family_type = ElementsOfFamilyType(family_types)
# note: Extract XYZ data from four point loaded families
locations = AdaptiveComponent.Locations(all_elements_of_family_type)
byPoints = PolyCurve.ByPoints(locations)
# note: Write each panel as a row of 12 numbers in Excel
string = StringInput("C:\Autodesk\Dynamo07\Core\samples\23 Data Import and Export\ExtractData.xlsx")
code_block = CodeBlock { "Data"; 0; }
create = List.Create()
flatten = Flatten(locations)
# note: Separate Point into coordinate components
X = Point.X(flatten)
Y = Point.Y(flatten)
Z = Point.Z(flatten)
# note: Combine XYZ components into a list of x, y, and z
combine = List.Combine(create, X, Y, Z)
flatten_2 = Flatten(combine)
code_block_2 = CodeBlock { 12; }
# note: Break into Rows of data, each row has 12 numbers to define 4 panel points
chop = List.Chop(flatten_2, code_block_2)
write = Excel.Write(string, code_block.out0, code_block.out1, code_block.out1, chop)
