# Dynamo graph ExcelDataImport.dyn (Dynamo 0.7.0.38229)

file_path = Filename("C:\Autodesk\Dynamo\Core\samples\23 Data Import and Export\DataImport.xlsx")
string = StringInput("Sheet1")
# note: Pull Quadrilateral Point Data from an Excel workbook
read = Excel.Read(file_path, string)
code_block = CodeBlock { 0; 3; }
# note: Sort numbers into XYZ coordinate elements
sublists = List.Sublists(arg1=code_block.out0, arg2=code_block.out1)
map = List.Map(read, sublists)
code_block_2 = CodeBlock { 1; 3; }
sublists_2 = List.Sublists(arg1=code_block_2.out0, arg2=code_block_2.out1)
map_2 = List.Map(read, sublists_2)
code_block_3 = CodeBlock { 2; 3; }
sublists_3 = List.Sublists(arg1=code_block_3.out0, arg2=code_block_3.out1)
map_3 = List.Map(read, sublists_3)
byCoordinates = Point.ByCoordinates(map, map_2, map_3)
flatten = Flatten()
# note: Flatten Groups of Quad Points
map_4 = List.Map(byCoordinates, flatten)
byPoints = PolyCurve.ByPoints(map_4)
byPerimeterPoints = Surface.ByPerimeterPoints(map_4)
byPoints_2 = AdaptiveComponent.ByPoints(map_4)
# note: Connect to Place Panels
family_types = FamilyTypes(index=18)
