# Dynamo custom node TransformOriginVectors.dyf (Dynamo 0.7.0.22524)
# category: Migration
# This node represents an upgrade of 0.6.3 TransformOriginVectors to 0.7.0

origin = Input()
up = Input()
asVector = Point.AsVector(up)
forward = Input()
asVector_2 = Point.AsVector(forward)
cross = Vector.Cross(asVector, asVector_2)
reverse = Vector.Reverse(cross)
byOriginVectors = CoordinateSystem.ByOriginVectors(origin, reverse, asVector_2, asVector, lacing=Longest)
CoordinateSystem = Output(byOriginVectors)
