# Dynamo custom node CurveLoop.dyf (Dynamo 0.6.2.26052)
# category: Geometry.Curve.Create

number = DoubleInput(0)
number_2 = DoubleInput(1)
XYZ = Xyz(number, number, number_2, lacing=Longest)
originZ = Input()
XYZ_2 = Xyz(number, number, originZ, lacing=Longest)
plane = Plane(XYZ, XYZ_2, lacing=Longest)
sketch_plane = SketchPlane(plane, lacing=Longest)
model_curve = ModelCurve(lacing=Longest)
fi = Input()
curves_from_family = CurvesFromFamilyInstance(fi, lacing=Longest)
map = Map(model_curve, curves_from_family)
watch = Watch(map)
curveelement_reference = CurveRef(watch, lacing=Longest)
