# Dynamo custom node DecideNewParent.dyf (Dynamo 0.6.3.30451)
# category: Misc

child_fit = Input()
parent_fit = Input()
less_than = LessThan(child_fit, parent_fit)
child = Input()
parent = Input()
if_ = Conditional(less_than, child, parent)
new_parent = Output(if_)
if_2 = Conditional(less_than, child_fit, parent_fit)
new_fittess = Output(if_2)
