# Dynamo custom node DecideNewParent_with_old_settings.dyf (Dynamo 0.6.3.16460)
# category: Misc

child_fit = Input()
parent_fit = Input()
greater_than = GreaterThan(child_fit, parent_fit)
child = Input()
parent = Input()
if_ = Conditional(greater_than, child, parent)
new_parent = Output(if_)
if_2 = Conditional(greater_than, child_fit, parent_fit)
new_fittess = Output(if_2)
previous_state = Input()
updateparameter_s = Custom[UpdateParameter(s)](seq=previous_state)  # [familyinstance, [parameter1,val][parameter2,val] iteration number]
string = StringInput("reverted to last state")
dynamologger_log = Custom[DynamoLogger.Log()](input=string)  # Uses the DynamoLogger and FSchemeInterop Utils class to print to the console
perform_all = Begin(expr1=updateparameter_s, expr2=dynamologger_log)
if_3 = Conditional(greater_than, child, perform_all)
debug_output = Output(if_3)
