# Dynamo custom node DynamicRelaxationLoop.dyf (Dynamo 0.6.2.26052)
# category: Analyze.Structure

ps = Input()
step = Input()
update = Input()
dynamic_relaxation_step = DynamicRelaxationStep(ps, step, update)
not_ = Not(dynamic_relaxation_step.out1)
pause = Pause(update)
dynamicRelaxationLoop = Custom[DynamicRelaxationLoop](ps=ps, update=update, step=step)
perform_all = Begin(expr1=dynamic_relaxation_step.out0, expr2=pause, expr3=dynamicRelaxationLoop)
empty_list = Empty()
if_ = Conditional(not_, perform_all, empty_list)
