# Dynamo custom node GraphFunction.dyf
# category: Logic.Math

number = DoubleInput(0)
XYZ = XYZ(arg2=number, lacing=Longest)
x_start = Input()  # "x-start"
x_end = Input()  # "x-end"
x_step = Input()  # "x-step"
number_sequence = BuildSeq(x_start, x_end, x_step, lacing=Longest)
y = Input(y = f(x))
map = Map(y, number_sequence)
combine = Combine(XYZ, number_sequence, map)
