# Dynamo custom node displayDataCall.dyf (Dynamo 0.6.3.30451)
# category: Misc

face = Input()
number = DoubleInput(6)
list = Input()
get_from_list = GetFromList(number, list)
number_2 = DoubleInput(3)
get_from_list_2 = GetFromList(number_2, list)
display_daylighting_data_on = Custom[Display Daylighting Data On Surface](face=face, xyz_sample_points=get_from_list, data=get_from_list_2)  # Displays daylighting data on a surface, requires manually setting up surface analysis display style through revit. Also requires wrapping with a transaction node.
transaction = Transaction(display_daylighting_data_on)
idx = Output(transaction)
