# Dynamo custom node get family instance params.dyf (Dynamo 0.6.3.16460)
# category: Misc

mutant = Input()
number = DoubleInput(0)
get_from_list = GetFromList(number, mutant)
get_family_instance_parameter = FamilyInstanceParameterGetter(get_from_list, lacing=Longest)  # "Get Family Instance Parameter Value"
number_2 = DoubleInput(1)
get_from_list_2 = GetFromList(number_2)
number_3 = DoubleInput(1)
get_from_list_3 = GetFromList(number_3, mutant)
map = Map(get_from_list_2, get_from_list_3)
map_2 = Map(get_family_instance_parameter, map)
python_script_with_variable = Python(mutant, map_2)  # "Python Script With Variable Number of Inputs"
# ---------- python_script_with_variable.python (24 lines) ----------
# Default imports
import clr
clr.AddReference('RevitAPI')
clr.AddReference('RevitAPIUI')
from Autodesk.Revit.DB import *
import Autodesk
import sys
import clr
path = r'C:\Autodesk\Dynamo\Core'
exec_path = r'C:\Autodesk\Dynamo\Core\dll'
sys.path.append(path)
sys.path.append(exec_path)
clr.AddReference('LibGNet')
from Autodesk.LibG import *

#The input to this node will be stored in the IN0...INX variable(s).
mutant = IN0
paramvalues = IN1

for i in range(len(mutant[1])):
	mutant[1][i][0] = paramvalues[i]

#Assign your output to the OUT variable
OUT = mutant
# ----------------------------------------
previous_family_settings_to_revert_back_ = Output(python_script_with_variable)  # "previous family settings to revert back to"
watch = Watch(get_from_list_3)
watch_2 = Watch(map)
watch_3 = Watch(map_2)
watch_4 = Watch(python_script_with_variable)
