# Dynamo custom node solarradopt.dyf
# category: Analyze.Solar

max = Input()
amt = Input()
greaterthanequals = GreaterThanEquals(max, amt)
fw = Input()
reset_file_watcher = FileWatcherReset(fw)
fI = Input()
p = Input()
set_instance_parameter = FamilyInstanceParameterSetter(fI, p, amt, lacing=Longest)
transaction = Transaction(set_instance_parameter)
number = DoubleInput(1000)
wait_for_change = FileWatcherWait(fw, number)
number_2 = DoubleInput(100)
pause = Pause(number_2)
i = Input()
add = Addition(i, amt, lacing=Longest)
acc = Input()
path = Input()
read_file = FileReader(path)
extract_solar_radiation_value = ComputeSolarRadiationValue(read_file)
solarradcomp = Custom[solarradcomp](old=acc, data=extract_solar_radiation_value, newAmt=amt)
solarradopt = Custom[solarradopt](fI=fI, p=p, i=i, max=max, amt=add, acc=solarradcomp, path=path, fw=fw)
begin = Begin(expr1=reset_file_watcher, expr2=transaction, expr3=wait_for_change, expr4=pause, expr5=solarradopt)
if_ = Conditional(greaterthanequals, begin, acc)
